# Dynamo graph 01 - Rooms outer hatch.dyn (Dynamo 1.3.0.875)

# group: Prend les Pièces et les filtre par "Ar_Espace de vente" Oui/Non
boolean = BoolSelector(true)
placedRooms = Custom[Collector.PlacedRooms](toggle=boolean)  # This will collect placed rooms in current file.
code_block = CodeBlock { "Ar_Espace de vente"; }
getParameterValueByName = Element.GetParameterValueByName(element=placedRooms, parameterName=code_block)
code_block_2 = CodeBlock { 1; }
eq = getParameterValueByName == code_block_2
filterByBoolMask = List.FilterByBoolMask(list=placedRooms, mask=eq)

categories = Categories("Rooms")
all_elements_of_category = ElementsOfCategory(categories)

# group: Récupère la limite exterieure des pièces
finishBoundary = Room.FinishBoundary(all_elements_of_category)

# group: OUTER CURVES
group_curves = Custom[Group Curves](Curves=finishBoundary@L2)  # This node will take any input of flat list of curves and group them into sublists containing "joinable" curves that is continous curves. They might form closed curves or open curves. Use PolyCurve.ByJoinedCurves to convert output groups of curves into single PolyCurves
endPoint = Curve.EndPoint(group_curves)
flatten = Flatten(endPoint@L2)
# note: Append Pt[0] to the end
python_script = Python(IN[0]=flatten)
# ---------- python_script.python (6 lines) ----------
list = IN[0]

for i in range(0,len(list)):
	list[i].append(list[i][0])
	
OUT = list
# ----------------------------------------

location = Room.Location(all_elements_of_category)
byOrigin = CoordinateSystem.ByOrigin(location)
code_block_3 = CodeBlock { 120; }
byWidthLength = Rectangle.ByWidthLength(cs=byOrigin, width=code_block_3, length=code_block_3)
explode = Geometry.Explode(byWidthLength)

# group: INNER CURVES
group_curves_2 = Custom[Group Curves](Curves=explode@L2)
endPoint_2 = Curve.EndPoint(group_curves_2)

flatten_2 = Flatten(endPoint_2@L2)

# group (continued): INNER CURVES
python_script_2 = Python(IN[0]=flatten_2)
# ---------- python_script_2.python (9 lines) ----------
list = IN[0]

newList = []

for i in range(0,len(list)):
	newList.append(list[i])
	newList[i].append(list[i][0])

OUT = newList
# ----------------------------------------

# group: FILLED REGION TYPE
element_types = ElementTypes("FilledRegionType")
all_elements_of_type = ElementsOfType(element_types)
code_block_4 = CodeBlock(a=all_elements_of_type) { {a[0]}; }
code_block_5 = CodeBlock(a=code_block_4) { a; }

# group: Create 1 filled region
code_block_6 = CodeBlock(a=python_script) { a[0]; }
python_script_3 = Python(IN[0]=code_block_6)
# ---------- python_script_3.python (18 lines) ----------
import clr

clr.AddReference('RevitAPI')
from Autodesk.Revit.DB import *

clr.AddReference("RevitNodes")
import Revit
# Import ToProtoType, ToRevitType geometry conversion extension methods
clr.ImportExtensions(Revit.GeometryConversion)


pts = IN[0]
elementlist = []

for pt in pts:
	elementlist.append(pt.ToRevitType())

OUT = elementlist
# ----------------------------------------
code_block_7 = CodeBlock(a=python_script_2) { {a[0]}; }
python_script_4 = Python(IN[0]=code_block_7)
# ---------- python_script_4.python (21 lines) ----------
import clr

clr.AddReference('RevitAPI')
from Autodesk.Revit.DB import *

clr.AddReference("RevitNodes")
import Revit
# Import ToProtoType, ToRevitType geometry conversion extension methods
clr.ImportExtensions(Revit.GeometryConversion)


pts = IN[0]
elementlist = []

for i in range(0,len(pts)):
	p = []
	elementlist.append(p)
	for j in range(0,len(pts[i])):
		p.append(pts[i][j].ToRevitType())

OUT = elementlist
# ----------------------------------------
python_script_5 = Python(IN[0]=python_script_3, IN[1]=python_script_4, IN[2]=code_block_5)  # frozen
# ---------- python_script_5.python (57 lines) ----------
import clr
clr.AddReference('ProtoGeometry')
from Autodesk.DesignScript.Geometry import *

# Import DocumentManager and TransactionManager
clr.AddReference("RevitServices")
import RevitServices
from RevitServices.Persistence import DocumentManager
from RevitServices.Transactions import TransactionManager

# Import RevitAPI
clr.AddReference("RevitAPI")
import Autodesk
from Autodesk.Revit.DB import *

doc = DocumentManager.Instance.CurrentDBDocument
uiapp = DocumentManager.Instance.CurrentUIApplication
app = uiapp.Application


regions = []
activeViewId = doc.ActiveView.Id;

TransactionManager.Instance.EnsureInTransaction(doc)

pts = UnwrapElement(IN[0])
innerPts = UnwrapElement(IN[1])

frt = UnwrapElement(IN[2])


profileLoops = []
outerProfileLoop = CurveLoop()
#innerProfileLoop = CurveLoop()

profileLoops.Add(outerProfileLoop)
#profileLoops.Add(innerProfileLoop)


#create filled region
for i in range(0,len(pts)-1):
	outerProfileLoop.Append(Autodesk.Revit.DB.Line.CreateBound(XYZ(pts[i].X,pts[i].Y,pts[i].Z),XYZ(pts[i+1].X,pts[i+1].Y,pts[i+1].Z)))

for j in range(0,len(innerPts)):
	innerProfileLoop = CurveLoop()
	profileLoops.Add(innerProfileLoop)
	for i in range(0,len(innerPts[j])-1):
		innerProfileLoop.Append(Autodesk.Revit.DB.Line.CreateBound(XYZ(innerPts[j][i].X,innerPts[j][i].Y,innerPts[j][i].Z),XYZ(innerPts[j][i+1].X,innerPts[j][i+1].Y,innerPts[j][i+1].Z)))


region = FilledRegion.Create(doc,frt[0].Id,activeViewId,profileLoops)
regions.Add(region)

TransactionManager.Instance.TransactionTaskDone()

#Assign your outputs to the OUT variable
OUT = regions
# ----------------------------------------

# group: convert dynamo points to revit points
python_script_6 = Python(IN[0]=python_script)  # same code as python_script_4
python_script_7 = Python(IN[0]=python_script_2)
# ---------- python_script_7.python (27 lines) ----------
import clr

clr.AddReference('RevitAPI')
from Autodesk.Revit.DB import *

clr.AddReference("RevitNodes")
import Revit
# Import ToProtoType, ToRevitType geometry conversion extension methods
clr.ImportExtensions(Revit.GeometryConversion)


pts = IN[0]
elementlist = []

for i in range(0,len(pts)):
	p = []
	elementlist.append(p)
	for j in range(0,len(pts[i])):
		p.append(pts[i][j].ToRevitType())

newList = []

for el in elementlist:
	newList.append([el])


OUT = newList
# ----------------------------------------

# group: Create multiple filled regions
python_script_8 = Python(IN[0]=python_script_6, IN[1]=python_script_7, IN[2]=code_block_5)  # frozen
# ---------- python_script_8.python (51 lines) ----------
import clr
clr.AddReference('ProtoGeometry')
from Autodesk.DesignScript.Geometry import *

# Import DocumentManager and TransactionManager
clr.AddReference("RevitServices")
import RevitServices
from RevitServices.Persistence import DocumentManager
from RevitServices.Transactions import TransactionManager

# Import RevitAPI
clr.AddReference("RevitAPI")
import Autodesk
from Autodesk.Revit.DB import *

doc = DocumentManager.Instance.CurrentDBDocument
uiapp = DocumentManager.Instance.CurrentUIApplication
app = uiapp.Application


regions = []
activeViewId = doc.ActiveView.Id;

outerCurves = UnwrapElement(IN[0])
innerCurves = UnwrapElement(IN[1])

filledRegionType = UnwrapElement(IN[2])

TransactionManager.Instance.EnsureInTransaction(doc)

for pts,innerPts in zip(outerCurves,innerCurves):
	profileLoops = []
	outerProfileLoop = CurveLoop()
	profileLoops.Add(outerProfileLoop)
	#create filled region
	for i in range(0,len(pts)-1):
		outerProfileLoop.Append(Autodesk.Revit.DB.Line.CreateBound(XYZ(pts[i].X,pts[i].Y,pts[i].Z),XYZ(pts[i+1].X,pts[i+1].Y,pts[i+1].Z)))

	for j in range(0,len(innerPts)):
		innerProfileLoop = CurveLoop()
		profileLoops.Add(innerProfileLoop)
		for i in range(0,len(innerPts[j])-1):
			innerProfileLoop.Append(Autodesk.Revit.DB.Line.CreateBound(XYZ(innerPts[j][i].X,innerPts[j][i].Y,innerPts[j][i].Z),XYZ(innerPts[j][i+1].X,innerPts[j][i+1].Y,innerPts[j][i+1].Z)))
			
	region = FilledRegion.Create(doc,filledRegionType[0].Id,activeViewId,profileLoops)
	regions.Add(region)

TransactionManager.Instance.TransactionTaskDone()

#Assign your outputs to the OUT variable
OUT = regions
# ----------------------------------------

all_elements_of_category_2 = ElementsOfCategory(categories)

# group: Create multiple filled region from rooms
python_script_9 = Python(IN[0]=all_elements_of_category_2, IN[1]=code_block_5)
# ---------- python_script_9.python (45 lines) ----------
import clr
clr.AddReference('ProtoGeometry')
from Autodesk.DesignScript.Geometry import *

# Import DocumentManager and TransactionManager
clr.AddReference("RevitServices")
import RevitServices
from RevitServices.Persistence import DocumentManager
from RevitServices.Transactions import TransactionManager

# Import RevitAPI
clr.AddReference("RevitAPI")
import Autodesk
from Autodesk.Revit.DB import *

doc = DocumentManager.Instance.CurrentDBDocument
uiapp = DocumentManager.Instance.CurrentUIApplication
app = uiapp.Application
activeViewId = doc.ActiveView.Id;

area = UnwrapElement(IN[0])

filledRegionType = UnwrapElement(IN[1])

opt = SpatialElementBoundaryOptions()
opt.StoreFreeBoundaryFaces = False
opt.SpatialElementBoundaryLocation.Center

listRegions = []

TransactionManager.Instance.EnsureInTransaction(doc)

for i in range(0,len(area)):
	profileLoops = []
	segs = area[i].GetBoundarySegments(opt)
	for i in range(0,len(segs)):
		pL = CurveLoop()
		profileLoops.Add(pL)	
		for j in range(0,len(segs[i])):
			pL.Append(segs[i][j].GetCurve())
	listRegions.append(FilledRegion.Create(doc,filledRegionType[0].Id,activeViewId,profileLoops))

TransactionManager.Instance.TransactionTaskDone()

OUT = listRegions
# ----------------------------------------
