# Dynamo graph 1-FixDiagonals.dyn "FixDiagonals" (Dynamo 2.0.1.5055)

select_model_elements = DSModelElementsSelection()  # 24 picked in the model

# group: Element category
python_script = Python(IN[0]=select_model_elements)
# ---------- python_script.python (30 lines) ----------
import clr

clr.AddReference('RevitAPI')
from Autodesk.Revit.DB import *
from Autodesk.Revit.DB.Structure import *

clr.AddReference('RevitAPIUI')
from Autodesk.Revit.UI import *

clr.AddReference('System')
from System.Collections.Generic import List

clr.AddReference('RevitNodes')
import Revit
clr.ImportExtensions(Revit.GeometryConversion)
clr.ImportExtensions(Revit.Elements)

clr.AddReference('RevitServices')
import RevitServices
from RevitServices.Persistence import DocumentManager
from RevitServices.Transactions import TransactionManager

doc = DocumentManager.Instance.CurrentDBDocument
uidoc=DocumentManager.Instance.CurrentUIApplication.ActiveUIDocument

#Preparing input from dynamo to revit
beams = UnwrapElement(IN[0])


OUT = [b.Category.Name for b in beams]
# ----------------------------------------

uniqueItems = List.UniqueItems(list=python_script)
allIndicesOf = List.AllIndicesOf(list=python_script, item=uniqueItems)
getItemAtIndex = List.GetItemAtIndex(list=select_model_elements, index=allIndicesOf)

# group: Diagonals+Chords
code_block = CodeBlock(a=getItemAtIndex) { a[1]; }
getLocation = Element.GetLocation(element=code_block)

length = Curve.Length(curve=getLocation)

# group: bottom chord length
code_block_2 = CodeBlock { 23000; }

gt = length > code_block_2
filterByBoolMask = List.FilterByBoolMask(list=code_block, mask=gt)

# group: Diagonals
code_block_3 = CodeBlock(a=filterByBoolMask.out) { a; }

# group: Columns
code_block_4 = CodeBlock(a=getItemAtIndex) { a[0]; }
getLocation_2 = Element.GetLocation(element=code_block_4)

# group: Chords
code_block_5 = CodeBlock(a=filterByBoolMask.in) { topChord = a[1]; }
code_block_6 = CodeBlock(a=filterByBoolMask.in) { bottomChord = a[0]; }

getLocation_3 = Element.GetLocation(element=code_block_5)
string = StringInput("Dimensions_Height_Nominal")
getParameterValueByName = Element.GetParameterValueByName(element=code_block_5, parameterName=string)
code_block_7 = CodeBlock(d=getParameterValueByName) { -d/2; }

# group: Get Top location and offset it d/2
translate = Geometry.Translate(geometry=getLocation_3, zTranslation=code_block_7)

ZAxis = Vector.ZAxis()

# group: Diagonal - Top Chord Points
project = Point.Project(point=getLocation_2, baseGeometry=translate, projectionDirection=ZAxis)

flatten = List.Flatten(list=project)

# group: Break diagonal profile
getLocation_4 = Element.GetLocation(element=code_block_3)
startPoint = Curve.StartPoint(curve=getLocation_4)
endPoint = Curve.EndPoint(curve=getLocation_4)

# group: Same as closest point to
distanceTo = Geometry.DistanceTo(geometry=startPoint, other=flatten, lacing=CrossProduct)
minimumItem = List.MinimumItem(list=distanceTo)
allIndicesOf_2 = List.AllIndicesOf(list=distanceTo, item=minimumItem, lacing=Longest)

# group: New Top Point
getItemAtIndex_2 = List.GetItemAtIndex(list=flatten, index=allIndicesOf_2)

# group: Change analytical model and get curve
python_script_2 = Python(IN[0]=code_block_6)
# ---------- python_script_2.python (45 lines) ----------
import clr

clr.AddReference('RevitAPI')
from Autodesk.Revit.DB import *
from Autodesk.Revit.DB.Structure import *

clr.AddReference('RevitAPIUI')
from Autodesk.Revit.UI import *

clr.AddReference('System')
from System.Collections.Generic import List

clr.AddReference('RevitNodes')
import Revit
clr.ImportExtensions(Revit.GeometryConversion)
clr.ImportExtensions(Revit.Elements)

clr.AddReference('RevitServices')
import RevitServices
from RevitServices.Persistence import DocumentManager
from RevitServices.Transactions import TransactionManager

doc = DocumentManager.Instance.CurrentDBDocument
uidoc=DocumentManager.Instance.CurrentUIApplication.ActiveUIDocument

#Preparing input from dynamo to revit
beam = UnwrapElement(IN[0])

analyticalModel = beam.GetAnalyticalModel()

TransactionManager.Instance.EnsureInTransaction(doc)

analyticalModel.SetProjection(AnalyticalElementSelector.Whole, StickElementProjectionY.Center, StickElementProjectionZ.Center)

curve = analyticalModel.GetCurve().ToProtoType()

#analyticalModel.LookupParameter("Start Alignment Method").Set(1)
#analyticalModel.LookupParameter("Start y Projection").Set(StickElementProjectionY.Center)
#analyticalModel.LookupParameter("End Alignment Method").Set(1)

TransactionManager.Instance.TransactionTaskDone()



OUT = curve
# ----------------------------------------

ZAxis_2 = Vector.ZAxis()

# group: Diagonal - Bottom Chord Points
project_2 = Point.Project(point=getLocation_2, baseGeometry=python_script_2, projectionDirection=ZAxis_2)

# group: Column bottom points
code_block_8 = CodeBlock(a=project_2) { a[1..9]; }

flatten_2 = List.Flatten(list=code_block_8)

# group: Same as closest point to
distanceTo_2 = Geometry.DistanceTo(geometry=endPoint, other=flatten_2, lacing=CrossProduct)
minimumItem_2 = List.MinimumItem(list=distanceTo_2)
allIndicesOf_3 = List.AllIndicesOf(list=distanceTo_2, item=minimumItem_2, lacing=Longest)

# group: New Bottom Point
getItemAtIndex_3 = List.GetItemAtIndex(list=flatten_2, index=allIndicesOf_3)

byStartPointEndPoint = Line.ByStartPointEndPoint(startPoint=getItemAtIndex_2, endPoint=getItemAtIndex_3)
flatten_3 = List.Flatten(list=byStartPointEndPoint)
setLocation = Element.SetLocation(element=code_block_3, geometry=flatten_3, lacing=Longest)
code_block_9 = CodeBlock { Color.ByARGB(0,255,0,0); }
overrideColorInView = Element.OverrideColorInView(element=code_block_3, color=code_block_9)  # frozen
code_block_10 = CodeBlock { Color.ByARGB(0,0,255,0); }
overrideColorInView_2 = Element.OverrideColorInView(element=code_block_4, color=code_block_10)  # frozen
code_block_11 = CodeBlock { Color.ByARGB(0,0,0,255); }
overrideColorInView_3 = Element.OverrideColorInView(element=filterByBoolMask.in, color=code_block_11)  # frozen
