# Dynamo graph 1-Section.dyn (Dynamo 1.3.2.2480)

byBoundingBox = SectionView.ByBoundingBox()  # unwired: arg0
select_model_element = DSModelElementSelection()  # 1 picked in the model
localCoordinateSystem = Custom[Element.LocalCoordinateSystem](element=select_model_element)  # Get the insertion point and local axes of an element.
code_block = CodeBlock { 0; }
code_block_2 = CodeBlock { 50; }
code_block_3 = CodeBlock { "Section Bb"; }
create_element_view = Custom[Create Element View](Xvector=localCoordinateSystem.Xvector, Yvector=localCoordinateSystem.Zvector, CropRegionOffset=code_block, ViewDepth=code_block_2, CSPoint=localCoordinateSystem.InsertionPoint, RevitElements=select_model_element, Viewname=code_block_3)  # This node makes it possible to automatically create aligned section views on selected elements. Necessary inputs are: Revit Elements: this to detect the solid.centroid. The views are oriented to that point. X-vectors and Y-vectors to get the direction of the section plane. Traditionally these vectors are taken from the location lines of linear objects or facing directions of generic elements (i.e. doors). You might replace this with the vector of a selected edge for instance.
code_block_4 = CodeBlock { {500,-500}; }
code_block_5 = CodeBlock { {-5000,10000}; }
translate = Geometry.Translate(geometry=localCoordinateSystem.InsertionPoint, xTranslation=code_block_4, zTranslation=code_block_5, lacing=CrossProduct)
flatten = Flatten(translate)
code_block_6 = CodeBlock(a=flatten) { {a[0],a[1],a[3],a[2]}; }
code_block_7 = CodeBlock { 1; }
byPoints = PolyCurve.ByPoints(points=code_block_6, connectLastToFirst=code_block_7)
setCropBoxCurves = Custom[View.SetCropBoxCurves](Curves=byPoints)  # Input views and lists of curves to set the view crop regions; unwired: Views
center = Polygon.Center()  # unwired: arg0
byBoundingBox_2 = SectionView.ByBoundingBox()  # unwired: arg0
geometry = Element.Geometry(select_model_element)
byCoordinateSystemMinPointMaxPoint = SectionView.ByCoordinateSystemMinPointMaxPoint()  # unwired: arg0, arg1, arg2
geometry_2 = Element.Geometry(select_model_element)
