# Dynamo graph 1-Section02.dyn (Dynamo 1.3.2.2480)

select_model_element = DSModelElementSelection()  # 1 picked in the model
code_block = CodeBlock { {"Section AAA","Section BBB"}; }
select_model_elements = DSModelElementsSelection()  # 24 picked in the model
localCoordinateSystem = Custom[Element.LocalCoordinateSystem](element=select_model_elements)  # Get the insertion point and local axes of an element.
code_block_2 = CodeBlock { {500,-500}; }
code_block_3 = CodeBlock { {40000,92200}; }
translate = Geometry.Translate(geometry=localCoordinateSystem.InsertionPoint, yTranslation=code_block_2, zTranslation=code_block_3, lacing=CrossProduct)
flatten = Flatten(translate)
code_block_4 = CodeBlock(a=flatten) { {a[0],a[1],a[3],a[2]}; }
boundingBox = Element.BoundingBox(select_model_elements)
properties = Custom[BoundingBox.Properties](boundingBox=boundingBox)  # Retrieves the centroid, width, depth and height of a given bounding box
code_block_5 = CodeBlock { 0; }
code_block_6 = CodeBlock { 50; }
code_block_7 = CodeBlock { 1..24; }
code_block_8 = CodeBlock(a=code_block_7) { "Section A"+a; }
create_element_view = Custom[Create Element View](Xvector=localCoordinateSystem.Xvector, Yvector=localCoordinateSystem.Zvector, CropRegionOffset=code_block_5, ViewDepth=code_block_6, CSPoint=localCoordinateSystem.InsertionPoint, RevitElements=select_model_elements, Viewname=code_block_8)  # This node makes it possible to automatically create aligned section views on selected elements. Necessary inputs are: Revit Elements: this to detect the solid.centroid. The views are oriented to that point. X-vectors and Y-vectors to get the direction of the section plane. Traditionally these vectors are taken from the location lines of linear objects or facing directions of generic elements (i.e. doors). You might replace this with the vector of a selected edge for instance.
deconstruct = List.Deconstruct(list=translate, lacing=Longest)
flatten_2 = Flatten(deconstruct.rest@L3)
reverse = List.Reverse(flatten_2, lacing=Longest)
code_block_9 = CodeBlock(a=deconstruct.first) { a; }
addItemToEnd = List.AddItemToEnd(item=reverse, list=code_block_9, lacing=Longest)
flatten_3 = Flatten(addItemToEnd@L3)
code_block_10 = CodeBlock { 1; }
byPoints = PolyCurve.ByPoints(points=flatten_3, connectLastToFirst=code_block_10)
explode = Geometry.Explode(byPoints)
setCropBoxCurves = Custom[View.SetCropBoxCurves](Views=create_element_view, Curves=explode, lacing=Longest)  # Input views and lists of curves to set the view crop regions
code_block_11 = CodeBlock(b=deconstruct.rest) { b; }
watch = Watch(addItemToEnd)
watch_2 = Watch(explode)
