# Dynamo graph 1. Cut Sections.dyn (Dynamo 2.2.0.4667)

python_script = Python()  # unwired: IN[0]
# ---------- python_script.python (31 lines) ----------
import clr

clr.AddReference("RevitAPIUI")
from Autodesk.Revit.UI import IExternalEventHandler, ExternalEvent, TaskDialog
from Autodesk.Revit.UI.Selection import *

clr.AddReference("RevitAPI")
from Autodesk.Revit.DB import Transaction, OverrideGraphicSettings, ElementId, Color
# noinspection PyUnresolvedReferences
from Autodesk.Revit.Exceptions import InvalidOperationException

clr.AddReference('RevitServices')
from RevitServices.Persistence import DocumentManager

doc = DocumentManager.Instance.CurrentDBDocument
uidoc=DocumentManager.Instance.CurrentUIApplication.ActiveUIDocument

class CustomISelectionFilter(ISelectionFilter):
	def __init__(self, category_name):
		self.category_name = category_name
	def AllowElement(self, e):
		if e.Category.Name == self.category_name:
			return True
		else:
			return False
	def AllowReference(self, ref, point):
		return false

ref = uidoc.Selection.PickObjects(ObjectType.Element, CustomISelectionFilter("Structural Columns"), "Select Multiple Beams")

OUT = [doc.GetElement(r) for r in ref]
# ----------------------------------------

# group: Python Script should replace custom node
localCoordinateSystem = Custom[Element.LocalCoordinateSystem](element=python_script)  # Get the insertion point and local axes of an element.
python_script_2 = Python(IN[0]=python_script)
# ---------- python_script_2.python (50 lines) ----------
import clr
clr.AddReference("ProtoGeometry")
from Autodesk.DesignScript.Geometry import *
# Import RevitAPI
clr.AddReference("RevitAPI")
from Autodesk.Revit.DB import *
clr.AddReference("RevitAPIUI")
from Autodesk.Revit.UI import TaskDialog
# Import DocumentManager and TransactionManager
clr.AddReference("RevitServices")
from RevitServices.Persistence import DocumentManager
from RevitServices.Transactions import TransactionManager
# Import ToProtoType, ToRevitType geometry conversion extension methods
clr.AddReference("RevitNodes")
import Revit
clr.ImportExtensions(Revit.GeometryConversion)

doc = DocumentManager.Instance.CurrentDBDocument

if isinstance(IN[0], list):
	columns = UnwrapElement(IN[0])
else:
	columns = [UnwrapElement(IN[0])]



points = []
handOrientation = []
xVector = []
yVector = []


for c in columns:
	try:
		location = c.Location.Point
		points.append(location.ToPoint())
		handOrientation = c.HandOrientation
		zVector = XYZ(0,0,1)
		xVector.append(handOrientation.ToVector())
		yVector.append(handOrientation.CrossProduct(-zVector).ToVector())
		
	except:
		location = c.Location.Curve
		points.append(location.Origin.ToPoint())
		handOrientation = c.HandOrientation.ToVector()
		zVector = location.ToProtoType().Direction.Reverse()
		xVector.append(handOrientation)
		yVector.append(handOrientation.Cross(zVector))

OUT = points, xVector, yVector
# ----------------------------------------

select_model_elements = DSModelElementsSelection()  # 12 picked in the model; graph input
code_block = CodeBlock { "58"; }
python_script_3 = Python(IN[0]=code_block)
# ---------- python_script_3.python (36 lines) ----------
import clr

clr.AddReference('RevitAPI')
from Autodesk.Revit.DB import *
from Autodesk.Revit.DB.Structure import *

clr.AddReference('RevitAPIUI')
from Autodesk.Revit.UI import *

clr.AddReference('System')
from System.Collections.Generic import List

clr.AddReference('RevitNodes')
import Revit
clr.ImportExtensions(Revit.GeometryConversion)
clr.ImportExtensions(Revit.Elements)

clr.AddReference('RevitServices')
import RevitServices
from RevitServices.Persistence import DocumentManager
from RevitServices.Transactions import TransactionManager

doc = DocumentManager.Instance.CurrentDBDocument

viewTypeName = IN[0]


fec = FilteredElementCollector(doc).OfClass(ViewFamilyType)

result = None

for f in fec:
	if (viewTypeName in f.LookupParameter("Type Name").AsString()):
		result = f

OUT = result
# ----------------------------------------
code_block_2 = CodeBlock(xVector=python_script_2, yVector=python_script_2, InsertionPoint=python_script_2) { xVector[1]; yVector[2]; InsertionPoint[0]; }

# group: Section Position and Far Clip Offset from column centreline [mm]
code_block_3 = CodeBlock { [0,500]; }

# group: Column width parameter
code_block_4 = CodeBlock { "Width Schedule"; }

python_script_4 = Python(IN[0]=python_script, IN[1]=code_block_4)
# ---------- python_script_4.python (37 lines) ----------
import clr

clr.AddReference('RevitAPI')
from Autodesk.Revit.DB import *
from Autodesk.Revit.DB.Structure import *

clr.AddReference('RevitAPIUI')
from Autodesk.Revit.UI import *

clr.AddReference('System')
from System.Collections.Generic import List

clr.AddReference('RevitNodes')
import Revit
clr.ImportExtensions(Revit.GeometryConversion)
clr.ImportExtensions(Revit.Elements)

clr.AddReference('RevitServices')
import RevitServices
from RevitServices.Persistence import DocumentManager
from RevitServices.Transactions import TransactionManager

doc = DocumentManager.Instance.CurrentDBDocument

def CalcWidth(bbox):
	maxPt = bbox.Max
	minPt = bbox.Min
	return int((maxPt.X - minPt.X)*304.8)

#Preparing input from dynamo to revit
elements = UnwrapElement(IN[0])

bboxes = [e.get_BoundingBox(doc.ActiveView) for e in elements]



OUT = [CalcWidth(b) for b in bboxes]
# ----------------------------------------
code_block_5 = CodeBlock { 1000; }

# group: Section Half Width from column origin [mm]
code_block_6 = CodeBlock(a=python_script_4, b=code_block_5) { (a/2+b); }

# group: Section Height from +0.00m [mm]
code_block_7 = CodeBlock { [-10900,32200]; }

# group: Flip section
boolean = BoolSelector(false)  # graph input

# group: Cross Section (Y-Vector)
# note: Xvector = section parallel to column width
# Yvector = cross section
code_block_8 = CodeBlock { [-500,500]; }
translate = Geometry.Translate(geometry=code_block_2.out2, direction=code_block_2.out1, distance=code_block_8@L1)
transpose = List.Transpose(lists=translate)
python_script_5 = Python(IN[0]=python_script, IN[1]=python_script_3, IN[2]=code_block_2.out2, IN[3]=transpose, IN[4]=code_block_3, IN[5]=code_block_6, IN[6]=code_block_7, IN[7]=boolean)
# ---------- python_script_5.python (94 lines) ----------
import clr
clr.AddReference("ProtoGeometry")
from Autodesk.DesignScript.Geometry import *
# Import RevitAPI
clr.AddReference("RevitAPI")
from Autodesk.Revit.DB import *
clr.AddReference("RevitAPIUI")
from Autodesk.Revit.UI import TaskDialog
# Import DocumentManager and TransactionManager
clr.AddReference("RevitServices")
from RevitServices.Persistence import DocumentManager
from RevitServices.Transactions import TransactionManager
# Import ToProtoType, ToRevitType geometry conversion extension methods
clr.AddReference("RevitNodes")
import Revit
clr.ImportExtensions(Revit.GeometryConversion)

doc = DocumentManager.Instance.CurrentDBDocument
uiapp = DocumentManager.Instance.CurrentUIApplication
app = uiapp.Application


def ToInternalUnits(value):
	getDocUnits = doc.GetUnits()
	getDisplayUnits = getDocUnits.GetFormatOptions(UnitType.UT_Length).DisplayUnits
	return UnitUtils.ConvertToInternalUnits(value, getDisplayUnits)

if isinstance(IN[0], list):
	wall = UnwrapElement(IN[0])
else:
	wall = [UnwrapElement(IN[0])]

vft = UnwrapElement(IN[1])

sectionList = []

if IN[7] == False:
	flip = 1
else:
	flip = -1


if isinstance(IN[5], list):
	width = UnwrapElement(IN[5])
else:
	width = [UnwrapElement(IN[5])]
	
	

for i in range(0,len(wall)):
	midpoint = UnwrapElement(IN[2])[i].ToXyz()
	'start point'
	p = UnwrapElement(IN[3])[i][0].ToXyz()
	'end point'
	q = UnwrapElement(IN[3])[i][1].ToXyz()
	
	'wall length'
	v = q - p
	
	min = XYZ(ToInternalUnits(-width[i]), ToInternalUnits(IN[6][0]), ToInternalUnits(IN[4][0])) #(width in plan, height view in section, position in plan)
	max = XYZ(ToInternalUnits(width[i]), ToInternalUnits(IN[6][1]), ToInternalUnits(IN[4][1]))


	if "Point" in wall[i].Location.ToString():
		walldir = v.Normalize() * flip #+- change view direction
	else:
		walldir = -v.Normalize() * flip #+- change view direction
		
	up = XYZ.BasisZ;
	viewdir = walldir.CrossProduct( up );
 
 
	t = Transform.Identity;
	t.Origin = XYZ(midpoint.X, midpoint.Y, 0) ;
	t.BasisX = walldir;
	t.BasisY = up;
	t.BasisZ = viewdir


	sectionBox = BoundingBoxXYZ();
	sectionBox.Transform = t;
	sectionBox.Min = min;
	sectionBox.Max = max;

	

	TransactionManager.Instance.EnsureInTransaction(doc)
	
	sectionList.append(ViewSection.CreateSection( doc, vft.Id, sectionBox ))
	
	TransactionManager.Instance.TransactionTaskDone()


OUT = sectionList
# ----------------------------------------

code_block_9 = CodeBlock { "View Name"; }
code_block_10 = CodeBlock { "Mark"; }
getParameterValueByName = Element.GetParameterValueByName(element=python_script, parameterName=code_block_10)
code_block_11 = CodeBlock(a=getParameterValueByName) { "Column Section " + a; }
setParameterByName = Element.SetParameterByName(element=python_script_5, parameterName=code_block_9, value=code_block_11)
code_block_12 = CodeBlock(item=setParameterByName) { DSCore.List.Flatten([item]); }
code_block_13 = CodeBlock { "70 - Sh - Column Schedule Sections"; }

# group: from steam nodes
python_script_6 = Python(IN[0]=code_block_12, IN[1]=code_block_13)
# ---------- python_script_6.python (49 lines) ----------
#template for python nodes in dynamo 1.0
#proposed by Julien Benoit @jbenoit44 
#http://aecuandme.wordpress.com/
import clr
clr.AddReference('ProtoGeometry')
from Autodesk.DesignScript.Geometry import *
# Import ToDSType(bool) extension method
clr.AddReference("RevitNodes")
import Revit
clr.ImportExtensions(Revit.Elements)
# Import geometry conversion extension methods
clr.ImportExtensions(Revit.GeometryConversion)
# Import DocumentManager and TransactionManager
clr.AddReference("RevitServices")
import RevitServices
from RevitServices.Persistence import DocumentManager
from RevitServices.Transactions import TransactionManager
from System.Collections.Generic import *
# Import RevitAPI
clr.AddReference("RevitAPI")
import Autodesk
from Autodesk.Revit.DB import *

doc = DocumentManager.Instance.CurrentDBDocument
uiapp = DocumentManager.Instance.CurrentUIApplication
app = uiapp.Application
uidoc=DocumentManager.Instance.CurrentUIApplication.ActiveUIDocument

viewTempName = IN[1]
views = []
for i in IN[0]:
	views.append(UnwrapElement(i))

# Start Transaction
TransactionManager.Instance.EnsureInTransaction(doc)

collector = FilteredElementCollector(doc).OfClass(View)
for i in collector:
	if i.IsTemplate == True and i.Name == viewTempName:
		viewTemp = i

for i in views:
	i.ViewTemplateId = viewTemp.Id
		

# End Transaction
TransactionManager.Instance.TransactionTaskDone()

OUT=views
# ----------------------------------------

elementType = Element.ElementType(element=python_script)
name = Element.Name(element=python_script_3)
