# Dynamo graph 180723Training_2.dyn (Dynamo 2.0.1.4955)

number = DoubleInput(0)
number_2 = DoubleInput(8)
number_3 = DoubleInput(10)
list_create = List.Create(item0=number, item1=number_2, item2=number_3)
code_block = CodeBlock { 0; }
categories = Categories(index=572)
all_elements_of_category = ElementsOfCategory(Category=categories)
code_block_2 = CodeBlock { [0,8,10]; }
removeItemAtIndex = List.RemoveItemAtIndex(list=all_elements_of_category, indices=code_block_2)
count = List.Count(list=removeItemAtIndex)
sequence = Sequence(start=code_block, amount=count)
type = Object.Type(obj=sequence)
string = StringInput("Sheet Number")
code_block_3 = CodeBlock { ["ARUP-123-DR-ST-"]; }
string_from_object = FromObject(obj=sequence)
code_block_4 = CodeBlock { 3; }
code_block_5 = CodeBlock { "0"; }
padLeft = String.PadLeft(str=string_from_object, newWidth=code_block_4, padChars=code_block_5)
add = code_block_3 + padLeft  # lacing=Longest
setParameterByName = Element.SetParameterByName(element=removeItemAtIndex, parameterName=string, value=add)
code_block_6 = CodeBlock { "Arup DIP Stamp"; }
code_block_7 = CodeBlock { 1; }
setParameterByName_2 = Element.SetParameterByName(element=setParameterByName, parameterName=code_block_6, value=code_block_7)
filterByBoolMask = List.FilterByBoolMask(list=setParameterByName)  # unwired: mask
