# Dynamo graph 2-SetElementLevel.dyn (Dynamo 0.8.2.2392)

# group: All categories
python_script = Python()
# ---------- python_script.python (38 lines) ----------
import clr
# Import RevitAPI
clr.AddReference("RevitAPI")
from Autodesk.Revit.DB import *
clr.AddReference("RevitAPIUI")
from Autodesk.Revit.UI import TaskDialog
# Import DocumentManager and TransactionManager
clr.AddReference("RevitServices")
from RevitServices.Persistence import DocumentManager
from RevitServices.Transactions import TransactionManager
# Import ToProtoType, ToRevitType geometry conversion extension methods
clr.AddReference("RevitNodes")
import Revit
clr.ImportExtensions(Revit.Elements)
clr.ImportExtensions(Revit.GeometryConversion)

doc = DocumentManager.Instance.CurrentDBDocument
uiapp = DocumentManager.Instance.CurrentUIApplication
app = uiapp.Application

collector = FilteredElementCollector( doc ).WhereElementIsNotElementType()

cat = []
bboxMin = []
bboxMax = []
error = []

for c in collector:
	#if (None != c.Category and c.Category.HasMaterialQuantities):
	try:
		bboxMin.append(c.get_BoundingBox(None).Min.ToPoint().Z)
		bboxMax.append(c.get_BoundingBox(None).Max.ToPoint().Z)
		cat.append(c)
	except:
		error.append(c)
			

OUT = cat, bboxMin,bboxMax, error
# ----------------------------------------

code_block = CodeBlock(a=python_script) { a[0]; }
code_block_2 = CodeBlock { "Level"; }

# group: Level Name
code_block_3 = CodeBlock { {"B07","P06","B05"}; }

# group: Level SSL
code_block_4 = CodeBlock { {602328,603618,604728}; }

code_block_5 = CodeBlock(a=python_script) { a[1]; }

# group: Min Point Z
python_script_2 = Python(IN[0]=code_block_4, IN[1]=code_block_5)
# ---------- python_script_2.python (6 lines) ----------
import clr

levels = IN[0]
toFind = IN[1]

OUT = [min(enumerate(levels), key=lambda x: abs(x[1]-f)) for f in toFind]
# ----------------------------------------

code_block_6 = CodeBlock { 0; }
getItemAtIndex = List.GetItemAtIndex(list=python_script_2, index=code_block_6, lacing=Longest)
getItemAtIndex_2 = List.GetItemAtIndex(list=code_block_3, index=getItemAtIndex)
code_block_7 = CodeBlock(a=python_script) { a[2]; }

# group: Max Point Z
python_script_3 = Python(IN[0]=code_block_4, IN[1]=code_block_7)  # same code as python_script_2

code_block_8 = CodeBlock { 0; }
getItemAtIndex_3 = List.GetItemAtIndex(list=python_script_3, index=code_block_8, lacing=Longest)
getItemAtIndex_4 = List.GetItemAtIndex(list=code_block_3, index=getItemAtIndex_3)
code_block_9 = CodeBlock(bot=getItemAtIndex_2, top=getItemAtIndex_4) { bot + top; }
setParameterByName = Element.SetParameterByName(element=code_block, parameterName=code_block_2, value=code_block_9)
id = Element.Id(code_block)
code_block_10 = CodeBlock { 8100960; }
allIndicesOf = List.AllIndicesOf(list=id, item=code_block_10)
