# Dynamo graph 20170104 TagElements.dyn (Dynamo 1.2.1.3083)

# group: MANUAL
# note: DYNAMO 1.0
# tomasz.puchala@arup.com
# REQUIREMENTS:
# -SPRING NODES
# -CLOCKWORK
# 1. SELECT ELEMENTS - DUCTS/TRAYS/PIPES - ISOLATE THEM
# 2. SELECT APPROPRIATE TAG
# 3. SET OFFSET
# 4. RUN SCRIPT

views = Views("Project View")

# group: 1
select_model_elements = DSModelElementsSelection()  # 112 picked in the model

location = Custom[Element.Location](element=select_model_elements)  # Returns the location of an element as an XYZ (or if it's line-based the start and end point of the line), along with some booleans to help filtering the results. Use this for some element types (e.g. walls or lines) that do not work with the built-in Get Family Instance Location node.
code_block = CodeBlock { "Size"; }
getParameterValueByName = Element.GetParameterValueByName(element=select_model_elements, parameterName=code_block)
python_script = Python(IN[0]=getParameterValueByName)
# ---------- python_script.python (7 lines) ----------
import re
c=[]
for i in IN[0]:
	b = re.findall("[-+]?\d+[\.]?\d*[eE]?[-+]?\d*", i)
	c.append(b)
#Assign your output to the OUT variable.
OUT = c
# ----------------------------------------
maximumItem = List.MaximumItem(python_script)
toNumber = String.ToNumber(maximumItem)
code_block_2 = CodeBlock { 2; }
div = toNumber / code_block_2

# group: 3
number_slider = DoubleSlider(220, range=100..500 step 1)

add = div + number_slider
code_block_3 = CodeBlock { 0; }
getItemAtIndex = List.GetItemAtIndex(index=code_block_3)  # unwired: list
map = List.Map(list=location.curveEndpoints, f_x=getItemAtIndex)
X = Point.X(map)
code_block_4 = CodeBlock { 1; }
getItemAtIndex_2 = List.GetItemAtIndex(index=code_block_4)  # unwired: list
map_2 = List.Map(list=location.curveEndpoints, f_x=getItemAtIndex_2)
X_2 = Point.X(map_2)
min = Math.Min(X, X_2)
python_script_2 = Python(IN[0]=X, IN[1]=X_2)
# ---------- python_script_2.python (5 lines) ----------
b=IN[1]
OUT = []
for i,x in enumerate(IN[0]):
	if x == b[i]:
		OUT.append(i)
# ----------------------------------------
getItemAtIndex_3 = List.GetItemAtIndex(list=min, index=python_script_2)
code_block_5 = CodeBlock { 500; }
sub = getItemAtIndex_3 - code_block_5
replaceItemAtIndex = Custom[List.ReplaceItemAtIndex](seq=min, index=python_script_2, replacement=sub)  # Replaces the item at a given index (or list of indices) of a list by another item
Y = Point.Y(map)
Y_2 = Point.Y(map_2)
max = Math.Max(value1=Y, value2=Y_2)
code_block_6 = CodeBlock { 0; }
byCoordinates = Point.ByCoordinates(x=replaceItemAtIndex, y=max, z=code_block_6)
offset = Custom[Curve.Offset+](curve=location.curves, distance=add, point=byCoordinates)  # "Springs.Curve.Offset+"; Offsets a curve towards the specified point
code_block_7 = CodeBlock { 0.5; }
pointAtParameter = Curve.PointAtParameter(curve=offset, param=code_block_7)

# group: 2
family_types = FamilyTypes("Duct Tag:Size + System")

get_revit_activeview = Custom[Get Revit ActiveView]()  # Active View
count = List.Count(select_model_elements)
ofRepeatedItem = List.OfRepeatedItem(item=get_revit_activeview, amount=count)
code_block_8 = CodeBlock { true; }
archi_lab_net = Python(IN[0]=pointAtParameter, IN[1]=family_types, IN[2]=select_model_elements, IN[3]=ofRepeatedItem, IN[5]=code_block_8)  # unwired: IN[4]
# ---------- archi_lab_net.python (146 lines) ----------
#Copyright(c) 2015, Konrad K Sobon
# @arch_laboratory, http://archi-lab.net

import clr
clr.AddReference('ProtoGeometry')
from Autodesk.DesignScript.Geometry import *

# Import Element wrapper extension methods
clr.AddReference("RevitNodes")
import Revit
clr.ImportExtensions(Revit.Elements)

# Import geometry conversion extension methods
clr.ImportExtensions(Revit.GeometryConversion)

# Import DocumentManager and TransactionManager
clr.AddReference("RevitServices")
import RevitServices
from RevitServices.Persistence import DocumentManager
from RevitServices.Transactions import TransactionManager

doc = DocumentManager.Instance.CurrentDBDocument
uiapp = DocumentManager.Instance.CurrentUIApplication
app = uiapp.Application

# Import RevitAPI
clr.AddReference("RevitAPI")
import Autodesk
from Autodesk.Revit.DB import *

import sys
pyt_path = r'C:\Program Files (x86)\IronPython 2.7\Lib'
sys.path.append(pyt_path)

#The inputs to this node will be stored as a list in the IN variable.
dataEnteringNode = IN

locationPts = UnwrapElement(IN[0])
tagType = UnwrapElement(IN[1])
elements = UnwrapElement(IN[2])

if IN[4] != None:
	link = UnwrapElement(IN[4])
else:
	link = None
	
RunIt = IN[5]

if isinstance(IN[3], list):
	views = [UnwrapElement(i) for i in IN[3]]
else:
	views = UnwrapElement(IN[3])

def toRvtPoint(point):
	return point.ToXyz()

def toRvtId(_id):
	if isinstance(_id, int) or isinstance(_id, str):
		id = ElementId(int(_id))
		return id
	elif isinstance(_id, ElementId):
		return _id

def GetUVPoint(pt):
	if type(pt) == Autodesk.DesignScript.Geometry.Point:
		return Autodesk.Revit.DB.UV(pt.X, pt.Y)
	elif type(pt) == Autodesk.DesignScript.Geometry.UV:
		return Autodesk.Revit.DB.UV(pt.U, pt.V)

def CreateSpaceTag(space, uv, view):
	doc = DocumentManager.Instance.CurrentDBDocument
	return doc.Create.NewSpaceTag(space, uv, view)

tagTypeId = toRvtId(tagType.Id)

try:
	errorReport = None
	if RunIt:
		if tagType.Category.Name == "Room Tags":
			TransactionManager.Instance.EnsureInTransaction(doc)
			roomTags = []
			if isinstance(views, list):
				for i, j, k in zip(elements, views, locationPts):
					roomId = LinkElementId(i.Id)
					location = Autodesk.Revit.DB.UV(toRvtPoint(k).X, toRvtPoint(k).Y)
					roomTag = doc.Create.NewRoomTag(roomId, location, j.Id)
					roomTag.RoomTagType = tagType
					roomTags.append(roomTag)
			else:
				for i, j in zip(elements, locationPts):
					if link != None:
						roomId = LinkElementId(link.Id, i.Id)
					else:
						roomId = LinkElementId(i.Id)
					location = Autodesk.Revit.DB.UV(toRvtPoint(j).X, toRvtPoint(j).Y)
					roomTag = doc.Create.NewRoomTag(roomId, location, views.Id)
					roomTag.RoomTagType = tagType
					roomTags.append(roomTag)
			TransactionManager.Instance.TransactionTaskDone()
			result = roomTags
		elif tagType.Category.Name == "Space Tags":
			TransactionManager.Instance.EnsureInTransaction(doc)
			roomTags = []
			if isinstance(views, list):
				for i, j, k in zip(elements, views, locationPts):
					uv = GetUVPoint(k)
					spaceTag = CreateSpaceTag(i, uv, j)
					spaceTag.SpaceTagType = tagType
					roomTags.append(spaceTag)
			else:
				for i, j in zip(elements, locationPts):
					uv = GetUVPoint(j)
					spaceTag = CreateSpaceTag(i, uv, views)
					spaceTag.SpaceTagType = tagType
					roomTags.append(spaceTag)
			TransactionManager.Instance.TransactionTaskDone()
			result = roomTags
		else:
			TransactionManager.Instance.EnsureInTransaction(doc)
			tags = []
			if isinstance(views, list):
				for i,j,k in zip(elements, views, locationPts):
					location = toRvtPoint(k)
					tag = doc.Create.NewTag(j, i, False, TagMode.TM_ADDBY_CATEGORY, TagOrientation.Horizontal, location)
					tag.ChangeTypeId(tagTypeId)
					tags.append(tag)
			else:
				for i, j in zip(elements, locationPts):
					location = toRvtPoint(j)
					tag = doc.Create.NewTag(views, i, False, TagMode.TM_ADDBY_CATEGORY, TagOrientation.Horizontal, location)
					tag.ChangeTypeId(tagTypeId)
					tags.append(tag)
			TransactionManager.Instance.TransactionTaskDone()
			result = tags
	else:
		result = "RunIt is set to False."
except:
	# if error accurs anywhere in the process catch it
	import traceback
	errorReport = traceback.format_exc()

#Assign your output to the OUT variable
if errorReport == None:
	OUT = result
else:
	OUT = errorReport
# ----------------------------------------
watch = Watch(archi_lab_net)
