# Dynamo graph 3dViewsPerLevel.dyn (Dynamo 1.3.1.1736)

# group: SELECT THE VIEW WITH THE EXTENTS TO BE COPIED
views = Views("3D Base")

categories = Categories("Levels")
all_elements_of_category = ElementsOfCategory(categories)
count = List.Count(all_elements_of_category)
ofRepeatedItem = List.OfRepeatedItem(item=views, amount=count)
name = Level.Name(all_elements_of_category)
code_block = CodeBlock(a=name) { "3D View Level "+a; }
code_block_2 = CodeBlock { "Duplicate"; }
duplicate = Archilab.Grimshaw.Views.View.Duplicate(ofRepeatedItem, code_block, code_block_2)
python_script = Python(IN[0]=views)
# ---------- python_script.python (40 lines) ----------
#Luke Stanley Johnson for Bakery
import clr
clr.AddReference('ProtoGeometry')
from Autodesk.DesignScript.Geometry import *

# Import ToDSType(bool) extension method
clr.AddReference("RevitNodes")
import Revit
clr.ImportExtensions(Revit.Elements)

# Import DocumentManager and TransactionManager
clr.AddReference("RevitServices")
import RevitServices
from RevitServices.Persistence import DocumentManager
from RevitServices.Transactions import TransactionManager

from System.Collections.Generic import *

clr.AddReference("RevitNodes")
import Revit
# Import ToProtoType, ToRevitType geometry conversion extension methods
clr.ImportExtensions(Revit.GeometryConversion)

# Import RevitAPI
clr.AddReference("RevitAPI")
import Autodesk

doc = DocumentManager.Instance.CurrentDBDocument
uiapp = DocumentManager.Instance.CurrentUIApplication
app = uiapp.Application


view = UnwrapElement(IN[0])

BBmin = view.GetSectionBox().ToProtoType().MinPoint
BBmax = view.GetSectionBox().ToProtoType().MaxPoint



OUT = [[BBmin, BBmax]]
# ----------------------------------------
ZAxis = Vector.ZAxis()
elevation = Level.Elevation(all_elements_of_category)
translate = Geometry.Translate(geometry=python_script, direction=ZAxis, distance=elevation, lacing=Longest)
deconstruct = List.Deconstruct(list=translate, lacing=Longest)
byCorners = BoundingBox.ByCorners(min=deconstruct.first, max=deconstruct.rest)
flatten = Flatten(byCorners)
python_script_2 = Python(IN[0]=duplicate, IN[1]=flatten)
# ---------- python_script_2.python (56 lines) ----------
import clr
clr.AddReference('ProtoGeometry')
from Autodesk.DesignScript.Geometry import *

# Import ToDSType(bool) extension method
clr.AddReference("RevitNodes")
import Revit
clr.ImportExtensions(Revit.Elements)

# Import DocumentManager and TransactionManager
clr.AddReference("RevitServices")
import RevitServices
from RevitServices.Persistence import DocumentManager
from RevitServices.Transactions import TransactionManager

from System.Collections.Generic import *

# Import RevitAPI
clr.AddReference("RevitAPI")
import Autodesk

clr.AddReference("RevitNodes")
import Revit
# Import ToProtoType, ToRevitType geometry conversion extension methods
clr.ImportExtensions(Revit.GeometryConversion)


doc = DocumentManager.Instance.CurrentDBDocument
uiapp = DocumentManager.Instance.CurrentUIApplication
app = uiapp.Application

#The inputs to this node will be stored as a list in the IN variable.
dataEnteringNode = IN

#unwrap all elements to use with API
views = UnwrapElement(IN[0])
boxes = IN[1]

TransactionManager.Instance.EnsureInTransaction(doc)
#apply lineweight override to elements in an input list
typelist = list()

for i in range(0,len(views)):
	try:
		views[i].SetSectionBox(boxes[i].ToRevitType())
		typelist.append(views[i])
		
	except:
		typelist.append(list())


# "End" the transaction
TransactionManager.Instance.TransactionTaskDone()

#Assign your output to the OUT variable
OUT = typelist
# ----------------------------------------
toCuboid = BoundingBox.ToCuboid(flatten)
