# Dynamo graph AlignSection04Face.dyn (Dynamo 1.3.1.1736)

select_edge = DSEdgeSelection()  # 1 picked in the model
byCurve = ModelCurve.ByCurve(select_edge)
revit_section_view_at_line = Custom[Revit Section View at Line](revitLines=byCurve)
select_face = DSFaceSelection()  # 1 picked in the model
perimeterCurves = Surface.PerimeterCurves(select_face)
length = Curve.Length(perimeterCurves)
code_block = CodeBlock(a=perimeterCurves) { a[0][0]; }
byGeometry = BoundingBox.ByGeometry(select_face)
toCuboid = BoundingBox.ToCuboid(byGeometry)
getLocation = Element.GetLocation(select_edge)
code_block_2 = CodeBlock { ViewDepth : double = 100; }
code_block_3 = CodeBlock { ViewHeight : double = 3000; }
code_block_4 = CodeBlock { FlipSection : bool = false; }
preflight_to_make_revit_section = Custom[Preflight to Make Revit Section Views from Lines](ViewDepth=code_block_2, element=byCurve, ViewHeight=code_block_3, flip=code_block_4)
curves = Element.Curves()  # unwired: arg0
code_block_5 = CodeBlock { element : Element; }  # unwired: arg0
code_block_6 = CodeBlock { CoordinateSystem; }
firstItem = List.FirstItem(select_edge)
startPoint = Curve.StartPoint(firstItem)
endPoint = Curve.EndPoint(firstItem)
deconstructPoint = Geometry.Points.DeconstructPoint(endPoint)
code_block_7 = CodeBlock(ViewHeight=code_block_3) { ViewHeight; }
code_block_8 = CodeBlock(z=deconstructPoint.out2, h=code_block_7) { z+h; }
byCoordinates = Point.ByCoordinates(x=deconstructPoint.out0, y=deconstructPoint.out1, z=code_block_8)
deconstructPoint_2 = Geometry.Points.DeconstructPoint(startPoint)
code_block_9 = CodeBlock(z=deconstructPoint_2.out2, h=code_block_7) { z+h; }
byCoordinates_2 = Point.ByCoordinates(x=deconstructPoint_2.out0, y=deconstructPoint_2.out1, z=code_block_9)
create = List.Create(startPoint, endPoint, byCoordinates, byCoordinates_2)
flatten = Flatten(create)
byPerimeterPoints = Surface.ByPerimeterPoints(flatten)
coordinateSystemAtParameter = Surface.CoordinateSystemAtParameter(byPerimeterPoints)
ZXPlane = CoordinateSystem.ZXPlane(coordinateSystemAtParameter)
code_block_10 = CodeBlock { flip : bool = false; }
code_block_11 = CodeBlock { 180; }
code_block_12 = CodeBlock { 0; }
if_ = If(test=code_block_10, true=code_block_11, false=code_block_12)
rotate = CoordinateSystem.Rotate(coordinateSystemAtParameter, ZXPlane, if_)
XYPlane = CoordinateSystem.XYPlane(rotate)
byPlane = CoordinateSystem.ByPlane(XYPlane)
XAxis = CoordinateSystem.XAxis(byPlane)
YAxis = CoordinateSystem.YAxis(byPlane)
origin = Plane.Origin(XYPlane)
vertices = Topology.Vertices(byPerimeterPoints)
pointGeometry = Vertex.PointGeometry(vertices)
identity = CoordinateSystem.Identity()
transform = Geometry.Transform(geometry=pointGeometry, fromCoordinateSystem=byPlane, contextCoordinateSystem=identity)
code_block_13 = CodeBlock { 0; }
code_block_14 = CodeBlock { ViewDepth : double = 100; }
preflight_for_section_view = Custom[Preflight for Section View Creation](xAxis=XAxis, yAxis=YAxis, csOrigin=origin, PointList=transform, CropRegionOffset=code_block_13, ViewDepth=code_block_14)
code_block_15 = CodeBlock(maxPoint=preflight_for_section_view.maxPoint) { maxPoint; }
code_block_16 = CodeBlock(minPoint=preflight_for_section_view.minPoint) { minPoint; }
select_edge_2 = DSEdgeSelection()  # 1 picked in the model
endPoint_2 = Curve.EndPoint(select_edge_2)
deconstructPoint_3 = Geometry.Points.DeconstructPoint(endPoint_2)
code_block_17 = CodeBlock(a=deconstructPoint_3.out0, b=deconstructPoint_3.out1, c=deconstructPoint_3.out2) { {a,b,c}; }
convert_between_units = DynamoConvert(code_block_17, conversionMetric=Length, conversionFrom=Millimeters, conversionTo=Feet)
startPoint_2 = Curve.StartPoint(select_edge_2)
deconstructPoint_4 = Geometry.Points.DeconstructPoint(startPoint_2)
code_block_18 = CodeBlock(a=deconstructPoint_4.out0, b=deconstructPoint_4.out1, c=deconstructPoint_4.out2) { {a,b,c}; }
convert_between_units_2 = DynamoConvert(code_block_18, conversionMetric=Length, conversionFrom=Millimeters, conversionTo=Feet)
