# Dynamo graph AlignSections.dyn (Dynamo 1.3.1.1736)

select_model_elements = DSModelElementsSelection()  # 1 picked in the model
select_model_element = DSModelElementSelection()  # 1 picked in the model
curves = Element.Curves(select_model_element)
location = StructuralFraming.Location(select_model_elements)
endPoint = Curve.EndPoint(location)
closestPointTo = Geometry.ClosestPointTo(geometry=curves, other=endPoint, lacing=Longest)
startPoint = Curve.StartPoint(location)
closestPointTo_2 = Geometry.ClosestPointTo(geometry=curves, other=startPoint, lacing=Longest)
python_script = Python(IN[0]=select_model_elements, IN[1]=closestPointTo, IN[2]=closestPointTo_2)
# ---------- python_script.python (44 lines) ----------
import clr

clr.AddReference("RevitServices")
import RevitServices
from RevitServices.Persistence import DocumentManager
from RevitServices.Transactions import TransactionManager
doc = DocumentManager.Instance.CurrentDBDocument

clr.AddReference("RevitAPI")
import Autodesk
from Autodesk.Revit.DB import *

clr.AddReference("RevitNodes")
import Revit
clr.ImportExtensions(Revit.Elements)
clr.ImportExtensions(Revit.GeometryConversion)

clr.AddReference("System")
from System.Collections.Generic import List

beamElement = UnwrapElement(IN[0])
#nBl = UnwrapElement(IN[1])
stPt = UnwrapElement(IN[1])
endPt = UnwrapElement(IN[2])



TransactionManager.Instance.EnsureInTransaction(doc)

#p1 = XYZ.Zero
#p2 = XYZ(10, 20, 0)

for i in range(0,len(stPt)):
	beamLine = beamElement[i].Location
	p1 = stPt[i].ToXyz()
	p2 = endPt[i].ToXyz()
	newBeamLine = Line.CreateBound(p1, p2)
	beamLine.Curve = newBeamLine;

            

TransactionManager.Instance.TransactionTaskDone()

OUT = beamElement
# ----------------------------------------
python_script_2 = Python(IN[0]=select_model_elements)
# ---------- python_script_2.python (39 lines) ----------
import clr

clr.AddReference("RevitServices")
import RevitServices
from RevitServices.Persistence import DocumentManager
from RevitServices.Transactions import TransactionManager
doc = DocumentManager.Instance.CurrentDBDocument

clr.AddReference("RevitAPI")
import Autodesk
from Autodesk.Revit.DB import *

clr.AddReference("RevitNodes")
import Revit
clr.ImportExtensions(Revit.Elements)
clr.ImportExtensions(Revit.GeometryConversion)

clr.AddReference("System")
from System.Collections.Generic import List

beamElement = UnwrapElement(IN[0])


beamLine = beamElement.Location

TransactionManager.Instance.EnsureInTransaction(doc)

#p1 = XYZ.Zero
#p2 = XYZ(10, 20, 0)

newbeamLine = XYZ.Zero

beamElement.Location = newbeamLine

            

TransactionManager.Instance.TransactionTaskDone()

OUT = beamLine
# ----------------------------------------
closestPointTo_3 = Geometry.ClosestPointTo(geometry=curves, other=python_script_2, lacing=Longest)
