# Dynamo custom node AttachColumnToTarget.dyf (Dynamo 1.3.0.875)
# category: Attach

Target = Input()
Columns = Input()
python_script = Python(IN[0]=Target, IN[1]=Columns)
# ---------- python_script.python (43 lines) ----------
import clr
 
clr.AddReference("RevitServices")
import RevitServices
from RevitServices.Persistence import DocumentManager
from RevitServices.Transactions import TransactionManager
doc =  DocumentManager.Instance.CurrentDBDocument

clr.AddReference("RevitNodes")
import Revit
clr.ImportExtensions(Revit.Elements)
clr.ImportExtensions(Revit.GeometryConversion)

clr.AddReference("RevitAPI")
from Autodesk.Revit.DB import *
from Autodesk.Revit.DB import ColumnAttachment

# Import System Collections...
import System
from System.Collections.Generic import *
from System import Enum

 

target = UnwrapElement(IN[0])
column = UnwrapElement(IN[1])



TransactionManager.Instance.EnsureInTransaction(doc)

cSt = ColumnAttachmentCutStyle.CutColumn
cAt = ColumnAttachmentJustification.Minimum

#cS = ColumnAttachment.CutStyle.SetValue(column,"CutColumn") 

ca = ColumnAttachment.AddColumnAttachment(doc,column,target,1,cSt,cAt,0)

#trans = ColumnAttachment.GetColumnAttachment(column, 1)

TransactionManager.Instance.TransactionTaskDone()

OUT = ca
# ----------------------------------------
OUT = Output(python_script)
