# Dynamo graph Change all Coarse Scale Fill Color of Category.dyn (Dynamo 2.0.1.5055)

red = CodeBlock { 170; }
green = CodeBlock { 170; }
blue = CodeBlock { 170; }
rgb_to_hexadecimal = Python(IN[0]=red, IN[1]=green, IN[2]=blue)
# ---------- rgb_to_hexadecimal.python (9 lines) ----------
r = IN[0]
g = IN[1]
b = IN[2]

def rgb2hex(r,g,b):
    hex = "#{:02x}{:02x}{:02x}".format(r,g,b)
    return hex

OUT = int(rgb2hex(r,g,b)[1:],16)
# ----------------------------------------
watch = Watch(rgb_to_hexadecimal)
categories = Categories(index=589)
all_elements_of_category = ElementsOfCategory(Category=categories)
elementType = Element.ElementType(element=all_elements_of_category)
uniqueItems = List.UniqueItems(list=elementType)
code_block = CodeBlock { "Coarse Scale Fill Color"; }
setParameterByName = Element.SetParameterByName(element=uniqueItems, parameterName=code_block, value=rgb_to_hexadecimal)
code_block_2 = CodeBlock { 170; }
byARGB = Color.ByARGB(r=code_block_2, g=code_block_2, b=code_block_2)
getParameterValueByName = Element.GetParameterValueByName(element=uniqueItems, parameterName=code_block)
parameters = Element.Parameters(element=uniqueItems)
storageType = Parameter.StorageType(parameter=parameters)
