# Dynamo graph ChangeBeamLocationCurve01.dyn (Dynamo 1.3.1.1736)

categories = Categories("StructuralFraming")
all_elements_of_category = ElementsOfCategory(categories)
categories_2 = Categories("StructuralColumns")
all_elements_of_category_2 = ElementsOfCategory(categories_2)
code_block = CodeBlock { 0; }
getSurroundingElements = Custom[Tool.GetSurroundingElements](Element=all_elements_of_category, ElementCheck=all_elements_of_category_2, Tolerance=code_block)  # Get Surrounding Elements by Categories, group them as List. Tolerance distance available.
deconstruct = List.Deconstruct(list=getSurroundingElements, lacing=Longest)
location = StructuralFraming.Location(deconstruct.first, lacing=Longest)

# group: column location point
python_script = Python(IN[0]=deconstruct.rest)
# ---------- python_script.python (23 lines) ----------
import clr
import math
clr.AddReference('RevitAPI')
from Autodesk.Revit.DB import *

clr.AddReference("RevitNodes")
import Revit
clr.ImportExtensions(Revit.GeometryConversion)

items = UnwrapElement(IN[0])

pointList = []

for i in range(0,len(items)):
	pt = []
	pointList.append(pt)
	for j in range(0,len(items[i])):
		pt.append(items[i][j].Location.Point.ToPoint())




OUT = pointList
# ----------------------------------------

ZAxis = Vector.ZAxis()
code_block_2 = CodeBlock(curve1=location) { point1 = curve1.PointAtParameter(0.5).Z; }
translate = Geometry.Translate(geometry=python_script, direction=ZAxis, distance=code_block_2)
code_block_3 = CodeBlock { "Dimensions_Width_Nominal"; }
getParameterValueByName = Element.GetParameterValueByName(element=deconstruct.rest, parameterName=code_block_3)

# group: column diameter x factor
code_block_4 = CodeBlock { 1.5; }
mul = getParameterValueByName * code_block_4  # lacing=Longest

byCenterPointRadius = Circle.ByCenterPointRadius(centerPoint=translate, radius=mul)
intersect = Geometry.Intersect(geometry=location, other=byCenterPointRadius)
flatten = Flatten(intersect@L3)

# group: change beam location curve
python_script_2 = Python(IN[0]=deconstruct.first, IN[1]=flatten)
# ---------- python_script_2.python (42 lines) ----------
import clr

clr.AddReference("RevitServices")
import RevitServices
from RevitServices.Persistence import DocumentManager
from RevitServices.Transactions import TransactionManager
doc = DocumentManager.Instance.CurrentDBDocument

clr.AddReference("RevitAPI")
import Autodesk
from Autodesk.Revit.DB import *

clr.AddReference("RevitNodes")
import Revit
clr.ImportExtensions(Revit.Elements)
clr.ImportExtensions(Revit.GeometryConversion)

clr.AddReference("System")
from System.Collections.Generic import List

beamElements = UnwrapElement(IN[0])
pts = UnwrapElement(IN[1])

beamLocations = []

for beam in beamElements:
	beamLocations.append(beam.Location)

newBeamLine = []

TransactionManager.Instance.EnsureInTransaction(doc)

for i in range(0,len(beamLocations)):
	newBeamLine = Line.CreateBound(pts[i][0].ToXyz(), pts[i][1].ToXyz())
	#Change the beam location line to a new line:
	beamLocations[i].Curve = newBeamLine;

            

TransactionManager.Instance.TransactionTaskDone()

OUT = beamElements
# ----------------------------------------

select_model_elements = DSModelElementsSelection()
select_model_elements_2 = DSModelElementsSelection()
