# Dynamo graph Coordinate System.dyn (Dynamo 2.1.0.6255)

# group: SELECT FAMILY TYPE
structural_column_types = StructuralColumnTypes()  # nothing selected; graph input

# group: COORDINATES FROM PBP
code_block = CodeBlock { 9187; 4322; 0; }
byCoordinates = Point.ByCoordinates(x=code_block.out0, y=code_block.out1, z=code_block.out2)

# group: COORDINATE SYSTEM ALIGNED WITH PROJECT NORTH, ORIGIN ON PBP
basePoint = Coordinates.BasePoint()
byOrigin = CoordinateSystem.ByOrigin(origin=basePoint)

# group: ROTATED COORDINATE SYSTEM (ALIGNED WITH TRUE NORTH)
XY = Plane.XY()
projectRotation = Coordinates.ProjectRotation()
rotate = CoordinateSystem.Rotate(coordinateSystem=byOrigin, plane=XY, degrees=projectRotation)

# group: TRANSFORM POINTS
transform = Geometry.Transform(geometry=byCoordinates, fromCoordinateSystem=byOrigin, contextCoordinateSystem=rotate)

# group: PLACE FAMILIES
byPoint = FamilyInstance.ByPoint(familyType=structural_column_types, point=transform)  # frozen

# group: SELECT FAMILY TYPE
structural_column_types_2 = StructuralColumnTypes()  # nothing selected; graph input

code_block_2 = CodeBlock { 8557; 17586; 0; }
byCoordinates_2 = Point.ByCoordinates(x=code_block_2.out0, y=code_block_2.out1, z=code_block_2.out2)
deconstructPoint = Geometry.Points.DeconstructPoint(point=byCoordinates_2)
code_block_3 = CodeBlock { 2057; 9786; 0; }
byCoordinates_3 = Point.ByCoordinates(x=code_block_3.out0, y=code_block_3.out1, z=code_block_3.out2)
deconstructPoint_2 = Geometry.Points.DeconstructPoint(point=byCoordinates_3)
code_block_4 = CodeBlock(x0=deconstructPoint.X, x1=deconstructPoint_2.X, y0=deconstructPoint.Y, y1=deconstructPoint_2.Y, z0=deconstructPoint.Z, z1=deconstructPoint_2.Z) { x0-x1; y0-y1; z0-z1; }
byCoordinates_4 = Point.ByCoordinates(x=code_block_4.out0, y=code_block_4.out1, z=code_block_4.out2)

# group: PLACE FAMILIES
byPoint_2 = FamilyInstance.ByPoint(familyType=structural_column_types_2, point=byCoordinates_4)  # frozen

# group: SELECT FAMILY TYPE
structural_column_types_3 = StructuralColumnTypes()  # nothing selected; graph input

code_block_5 = CodeBlock { 8557; 17586; 0; }
byCoordinates_5 = Point.ByCoordinates(x=code_block_5.out0, y=code_block_5.out1, z=code_block_5.out2)
surveyPoint = Coordinates.SurveyPoint()
basePoint_2 = Coordinates.BasePoint()
byTwoPoints = Vector.ByTwoPoints(start=surveyPoint, end=basePoint_2)
subtract = Point.Subtract(point=byCoordinates_5, vectorToSubtract=byTwoPoints)

# group: PLACE FAMILIES
byPoint_3 = FamilyInstance.ByPoint(familyType=structural_column_types_3, point=subtract)  # frozen

# group: SELECT FAMILY TYPE
structural_column_types_4 = StructuralColumnTypes()  # nothing selected; graph input

# group: PLACE FAMILIES
code_block_6 = CodeBlock { 6500; 7800; 0; }
byCoordinates_6 = Point.ByCoordinates(x=code_block_6.out0, y=code_block_6.out1, z=code_block_6.out2)
byPoint_4 = FamilyInstance.ByPoint(familyType=structural_column_types_4, point=byCoordinates_6)  # frozen

# group: PLACE FAMILIES
byPoint_5 = FamilyInstance.ByPoint()  # unwired: familyType, point

# group: SELECT FAMILY TYPE
structural_column_types_5 = StructuralColumnTypes(index=0)  # graph input

# group: COORDINATES FROM SURVEY POINT
code_block_7 = CodeBlock { 7745; 4847; 0; }
byCoordinates_7 = Point.ByCoordinates(x=code_block_7.out0, y=code_block_7.out1, z=code_block_7.out2)

# group: GET REVIT PROJECT BASE POINT COORDINATES AND ROTATION
categories = Categories(index=451)  # graph input
all_elements_of_category = ElementsOfCategory(Category=categories)
code_block_8 = CodeBlock { ["E/W","N/S","Elev","Angle to True North"]; }
getParameterValueByName = Element.GetParameterValueByName(element=all_elements_of_category, parameterName=code_block_8, lacing=Longest)
code_block_9 = CodeBlock(a=getParameterValueByName) { a[0]; }
code_block_10 = CodeBlock(a=getParameterValueByName) { a[1]; }
code_block_11 = CodeBlock(a=getParameterValueByName) { a[2]; }
byOrigin_2 = CoordinateSystem.ByOrigin(x=code_block_9, y=code_block_10, z=code_block_11)

# group: COORDINATE SYSTEM ALIGNED WITH PROJECT NORTH, ORIGIN ON PBP
basePoint_3 = Coordinates.BasePoint()
code_block_12 = CodeBlock(a=basePoint_3) { a.X; a.Y; a.Z; }
byOrigin_3 = CoordinateSystem.ByOrigin(x=code_block_12.out0, y=code_block_12.out1, z=code_block_12.out2)

# group: ROTATED COORDINATE SYSTEM (ALIGNED WITH TRUE NORTH)
XY_2 = Plane.XY()
projectRotation_2 = Coordinates.ProjectRotation()
rotate_2 = CoordinateSystem.Rotate(coordinateSystem=byOrigin_3, plane=XY_2, degrees=projectRotation_2)

# group: TRANSFORM POINTS
transform_2 = Geometry.Transform(geometry=byCoordinates_7, fromCoordinateSystem=byOrigin_2, contextCoordinateSystem=rotate_2)

levels = Levels(index=0)
byPointAndLevel = FamilyInstance.ByPointAndLevel(familyType=structural_column_types_5, point=transform_2, level=levels)

# group: SELECT FAMILY TYPE
structural_column_types_6 = StructuralColumnTypes(index=0)  # graph input

python_script = Python()
# ---------- python_script.python (31 lines) ----------
import clr
clr.AddReference('RevitAPI')
from Autodesk.Revit.DB import *
import Autodesk

clr.AddReference("RevitServices")
import RevitServices
from RevitServices.Persistence import DocumentManager

import math

doc = DocumentManager.Instance.CurrentDBDocument

getDocUnits = doc.GetUnits()
getDisplayUnits = getDocUnits.GetFormatOptions(UnitType.UT_Length).DisplayUnits 



projloc = doc.ActiveProjectLocation
position_data = projloc.GetProjectPosition(XYZ.Zero)
location_data = projloc.GetSiteLocation()

elevation = UnitUtils.ConvertFromInternalUnits(position_data.Elevation, getDisplayUnits)

x = UnitUtils.ConvertFromInternalUnits(position_data.EastWest, getDisplayUnits)

y = UnitUtils.ConvertFromInternalUnits(position_data.NorthSouth, getDisplayUnits)

angle = position_data.Angle * 180 / math.pi

OUT = (-angle, elevation, x, y)
# ----------------------------------------
code_block_13 = CodeBlock(origin=python_script) { transform(x,y,z,origin[0],origin[2],origin[3]); }  # unwired: x, y, z

# group: PLACE FAMILIES
byPoint_6 = FamilyInstance.ByPoint(familyType=structural_column_types_6, point=code_block_13)

levels_2 = Levels(index=0)
byPointAndLevel_2 = FamilyInstance.ByPointAndLevel(level=levels_2)  # unwired: familyType, point
code_block_14 = CodeBlock()
# ---------- code_block_14.designscript (10 lines) ----------
def transform(x,y,z,alfa,a,b){

xtransformed = (x-a)*Math.Cos(alfa)-(y-b)*Math.Sin(alfa);
ytransformed = (x-a)*Math.Sin(alfa)+(y-b)*Math.Cos(alfa);

pt = Autodesk.Point.ByCoordinates(xtransformed, ytransformed,z);

return pt;

};
# ----------------------------------------
element_types = ElementTypes(index=341)
