# Dynamo graph Create Beam Tags _GB_01.dyn (Dynamo 2.0.1.5055)

select_model_elements = DSModelElementsSelection()  # 3 picked in the model

# group: Get Identity_Type Mark
string = StringInput("Identity_Type Mark")
get_type_parameter = Custom[Get Type Parameter](element=select_model_elements, parameterName=string)  # This node will retrieve a type parameter by its name.
string_from_object = FromObject(obj=get_type_parameter)
watch = Watch(string_from_object)

# group: Obtain Element ID
id = Element.Id(element=select_model_elements)
string_from_object_2 = FromObject(obj=id)

unique_beam_id = Watch(string_from_object_2)
code_block = CodeBlock { 1; }
chop = List.Chop(list=unique_beam_id, lengths=code_block)

# group: Determine Beam size
string_2 = StringInput("Type")
getParameterValueByName = Element.GetParameterValueByName(element=select_model_elements, parameterName=string_2)
string_from_object_3 = FromObject(obj=getParameterValueByName)
code_block_2 = CodeBlock { 13; }
code_block_3 = CodeBlock { 25; }
substring = String.Substring(str=string_from_object_3, startIndex=code_block_2, length=code_block_3)
string_3 = StringInput(",")
split = String.Split(str=substring, separater0=string_3)
code_block_4 = CodeBlock { 0; }
getItemAtIndex = List.GetItemAtIndex(list=split, index=code_block_4, lacing=Longest)

beam_sizes = Watch(getItemAtIndex)
code_block_5 = CodeBlock { 1; }
chop_2 = List.Chop(list=beam_sizes, lengths=code_block_5)

# group: Interrogate beam parameters and returns text string level
string_4 = StringInput("Reference Level")
getParameterValueByName_2 = Element.GetParameterValueByName(element=select_model_elements, parameterName=string_4)
string_from_object_4 = FromObject(obj=getParameterValueByName_2)
code_block_6 = CodeBlock { 17; }
code_block_7 = CodeBlock { 2; }
substring_2 = String.Substring(str=string_from_object_4, startIndex=code_block_6, length=code_block_7)

levels = Watch(substring_2)
code_block_8 = CodeBlock { 1; }
chop_3 = List.Chop(list=levels, lengths=code_block_8)

# group: Define PB or SB
string_5 = StringInput("Structural Usage")
getParameterValueByName_3 = Element.GetParameterValueByName(element=select_model_elements, parameterName=string_5)
watch_2 = Watch(getParameterValueByName_3)
code_block_9 = CodeBlock { 4; }
lt = watch_2 < code_block_9
string_from_object_5 = FromObject(obj=lt)
string_6 = StringInput("false")
string_7 = StringInput("SB")
replace = String.Replace(str=string_from_object_5, searchFor=string_6, replaceWith=string_7)
string_8 = StringInput("true")
string_9 = StringInput("PB")
replace_2 = String.Replace(str=replace, searchFor=string_8, replaceWith=string_9)

pb_or_sb = Watch(replace_2)
code_block_10 = CodeBlock { 1; }
chop_4 = List.Chop(list=pb_or_sb, lengths=code_block_10)

# group: Find Beam Centre points
getLocation = Element.GetLocation(element=select_model_elements)
code_block_11 = CodeBlock { 0.5; }
pointAtParameter = Curve.PointAtParameter(curve=getLocation, param=code_block_11)
X = Point.X(point=pointAtParameter)
Y = Point.Y(point=pointAtParameter)

# group: Coordinates at Grid A-01
code_block_12 = CodeBlock { -67286.598; }
code_block_13 = CodeBlock { 559.835; }

# group: distance from base point to beam CL's
sub = X - code_block_12
code_block_14 = CodeBlock { 1000; }
div = sub / code_block_14
sub_2 = Y - code_block_13
code_block_15 = CodeBlock { 1000; }
div_2 = sub_2 / code_block_15

x_coordinates = Watch(div)
abs = Math.Abs(number=x_coordinates)
code_block_16 = CodeBlock { 5; }
round = Math.Round(number=abs, digits=code_block_16)
code_block_17 = CodeBlock { 1; }
chop_5 = List.Chop(list=round, lengths=code_block_17)
y_coordinates = Watch(div_2)
round_2 = Math.Round(number=y_coordinates, digits=code_block_16)
code_block_18 = CodeBlock { 1; }
chop_6 = List.Chop(list=round_2, lengths=code_block_18)
list_create = List.Create(item0=chop, item1=chop_2, item2=chop_3, item3=chop_4, item4=chop_5, item5=chop_6)

# group: Write to Excel
file_path = Filename(".\CQT Beam Schedule.xlsx")
string_10 = StringInput("Sheet1")
code_block_19 = CodeBlock { 2; }
code_block_20 = CodeBlock { [0..5]; }
transpose = List.Transpose(lists=code_block_20)
exportExcel = Data.ExportExcel(filePath=file_path, sheetName=string_10, startRow=code_block_19, startCol=transpose, data=list_create)  # frozen

# group: For Upper Ground Only Replaces Gr with UG
string_11 = StringInput("Gr")
string_12 = StringInput("UG")
replace_3 = String.Replace(str=substring_2, searchFor=string_11, replaceWith=string_12)

current = Document.Current()
activeView = Document.ActiveView(document=current)
watch_3 = Watch(activeView)

# group: For L5 mezz Only Replaces 05 with 05M
string_13 = StringInput("05")
string_14 = StringInput("05M")
replace_4 = String.Replace(str=substring_2, searchFor=string_13, replaceWith=string_14)

code_block_21 = CodeBlock { 0; }

# group: TURNS "1" INTO "01"
round_3 = Math.Round(number=abs, digits=code_block_21)
string_from_object_6 = FromObject(obj=round_3)
string_15 = StringInput(".")
split_2 = String.Split(str=string_from_object_6, separater0=string_15)
code_block_22 = CodeBlock { 0; }
getItemAtIndex_2 = List.GetItemAtIndex(list=split_2, index=code_block_22, lacing=Longest)
code_block_23 = CodeBlock { 2; }
string_16 = StringInput("0")
padLeft = String.PadLeft(str=getItemAtIndex_2, newWidth=code_block_23, padChars=string_16)

# group: TURNS "1" INTO "01"
round_4 = Math.Round(number=y_coordinates, digits=code_block_21)
string_from_object_7 = FromObject(obj=round_4)
string_17 = StringInput(".")
split_3 = String.Split(str=string_from_object_7, separater0=string_17)
code_block_24 = CodeBlock { 0; }
getItemAtIndex_3 = List.GetItemAtIndex(list=split_3, index=code_block_24, lacing=Longest)
code_block_25 = CodeBlock { 2; }
string_18 = StringInput("0")
padLeft_2 = String.PadLeft(str=getItemAtIndex_3, newWidth=code_block_25, padChars=string_18)

list_create_2 = List.Create(item0=levels, item1=pb_or_sb, item2=padLeft, item3=padLeft_2)
transpose_2 = List.Transpose(lists=list_create_2)
concat = String.Concat(string0=transpose_2)
watch_4 = Watch(concat)
flatten = List.Flatten(list=watch_4)
string_19 = StringInput("Mark")

# group: original
getParameterValueByName_4 = Element.GetParameterValueByName(element=select_model_elements, parameterName=string_19)

python_script = Python(IN[0]=flatten, IN[1]=getParameterValueByName_4, IN[2]=select_model_elements)
# ---------- python_script.python (21 lines) ----------
existing = IN[1]
new = IN[0]
elements = IN[2]

notChanged = []
changed = []
newers = []


for i in range(0,len(elements)):
	if existing[i] == new[i]:
		notChanged.append(elements[i])
	elif existing[i] == "":
		newers.append(elements[i])
	else:
		changed.append(elements[i])



# Assign your output to the OUT variable.
OUT = notChanged, changed, newers
# ----------------------------------------
code_block_26 = CodeBlock(a=python_script) { a[0]; }
code_block_27 = CodeBlock { color1 = Color.ByARGB(255, 0, 255, 0); color2 = Color.ByARGB(255, 255, 255, 0); color3 = Color.ByARGB(255, 255, 0, 0); }

# group: Not changed
overrideColorInView = Element.OverrideColorInView(element=code_block_26, color=code_block_27.color1)

code_block_28 = CodeBlock(a=python_script) { a[1]; }

# group: Changed
overrideColorInView_2 = Element.OverrideColorInView(element=code_block_28, color=code_block_27.color2)

code_block_29 = CodeBlock(a=python_script) { a[2]; }

# group: New
overrideColorInView_3 = Element.OverrideColorInView(element=code_block_29, color=code_block_27.color3)

code_block_30 = CodeBlock { " "; }
code_block_31 = CodeBlock { "OK"; }
code_block_32 = CodeBlock { "Accept Changes"; }
ui_boolean_input = Custom[UI.Boolean input](SideText=code_block_32)  # Creates a boolean input for UI.MultipleInputForm ++ . Check out www.data-shapes.net for more infos!
boolean = BoolSelector(true)

# group: obtain point for tags
startPoint = Curve.StartPoint(curve=getLocation)
endPoint = Curve.EndPoint(curve=getLocation)
byTwoPoints = Vector.ByTwoPoints(start=startPoint, end=endPoint)
ZAxis = Vector.ZAxis()
cross = Vector.Cross(vector=byTwoPoints, cross=ZAxis)
normalized = Vector.Normalized(vector=cross)
code_block_33 = CodeBlock(vct=cross) { vct.Y>0; }
code_block_34 = CodeBlock { 350; }
code_block_35 = CodeBlock { -350; }
if_ = If(test=code_block_33, true=code_block_34, false=code_block_35)
scale = Vector.Scale(vector=normalized, scale_factor=if_)
translate = Geometry.Translate(geometry=pointAtParameter, direction=scale)

code_block_36 = CodeBlock { 1; }

# group: Tag Element with new tag
family_types = FamilyTypes(index=47)
string_20 = StringInput("Mark")
setParameterByName = Element.SetParameterByName(element=select_model_elements, parameterName=string_20, value=flatten)
create_annotation_tag = Custom[Create Annotation Tag](TagLocations=translate, TagType=family_types, Elements=setParameterByName, Views=activeView, RunIt=code_block_36)  # This node will create an annotation tag at a given location, of given type and in a supplied view. If only single view is supplied then all tags will be created in that view.

code_block_37 = CodeBlock(passthrough=boolean, waitfor=create_annotation_tag) { [passthrough,waitfor][0]; }
code_block_38 = CodeBlock { "Cancel"; }
ui_multipleinputform = Custom[UI.MultipleInputForm ++](Logo_optional=code_block_30, ButtonText_optional=code_block_31, Inputs=ui_boolean_input, Toggle=code_block_37, CancelButtonText_optional=code_block_38)  # Create a form with multiple inputs. see www.data-shapes.net for tutorials and infos!
python_script_2 = Python(IN[0]=select_model_elements, IN[1]=ui_multipleinputform.User_Inputs)
# ---------- python_script_2.python (32 lines) ----------
import clr
clr.AddReference('RevitAPI')
from Autodesk.Revit.DB import *

clr.AddReference("RevitNodes")
import Revit
clr.ImportExtensions(Revit.Elements)

clr.AddReference("RevitServices")
import RevitServices
from RevitServices.Persistence import DocumentManager
from RevitServices.Transactions import TransactionManager

doc = DocumentManager.Instance.CurrentDBDocument
items = UnwrapElement(IN[0])
view = doc.ActiveView
booleans = []

override = OverrideGraphicSettings()

TransactionManager.Instance.EnsureInTransaction(doc)
for item in items:
	try:
		view.SetElementOverrides(item.Id, override)
		booleans.append(True)
	except: booleans.append(False)
TransactionManager.Instance.TransactionTaskDone()

if IN[1] == False:
	OUT = items
else:
	OUT = "Do nothing"
# ----------------------------------------
string_21 = StringInput("Mark")
setParameterByName_2 = Element.SetParameterByName(element=python_script_2, parameterName=string_21, value=getParameterValueByName_4)
