# Dynamo graph DYN-STR-DES-0010_AreaLoading_0.0.1.dyn (Dynamo 1.3.1.1736)

# group: Re-import Model
# note: If you update the model, toggle the boolean to false, run the script and then return value to true before running.
boolean = BoolSelector(true)

# group: LunchBox AreaElement Collector
python_script = Python(IN[0]=boolean)
# ---------- python_script.python (110 lines) ----------
#Copyright(c) 2014, Nathan Miller
# The Proving Ground, http://theprovingground.org

import clr

# Import RevitAPI
clr.AddReference("RevitAPI")
import Autodesk
from Autodesk.Revit.DB import *

# Import DocumentManager and TransactionManager
clr.AddReference("RevitServices")
import RevitServices
from RevitServices.Persistence import DocumentManager
from RevitServices.Transactions import TransactionManager

# Import ToDSType(bool) extension method
clr.AddReference("RevitNodes")
import Revit
clr.ImportExtensions(Revit.Elements)
clr.ImportExtensions(Revit.GeometryConversion)

import clr
clr.AddReference('ProtoGeometry')
from Autodesk.DesignScript.Geometry import *

#The input to this node will be stored in the IN[0] variable.

doc =  DocumentManager.Instance.CurrentDBDocument
app =  DocumentManager.Instance.CurrentUIApplication.Application

toggle = IN[0]

output = []
rooms = []
names = []
numbers = []
areas = []
levels = []
boundaries = []
locations = []
areaschemes = []
elementids = []
uniqueids = []

if toggle == True:

	collector = FilteredElementCollector(doc)
	collector.OfCategory(BuiltInCategory.OST_Areas)
 
	famtypeitr = collector.GetElementIdIterator()
	famtypeitr.Reset()


	for item in famtypeitr:
		famtypeID = item
		faminst = doc.GetElement(famtypeID)
    
		#print faminst
		if faminst.Area > 0:
			room = faminst
			for p in room.Parameters:
				if p.Definition.Name == 'LoadDescription':		
					roomname = p.AsString()
				if p.Definition.Name == 'Level':			
					level = p.AsValueString()
					if (level is None):
						level = p.AsString()

			number = faminst.Number
			area = faminst.Area
			location = faminst.Location.Point.ToPoint()
			areascheme = faminst.AreaScheme.Name
			elementid = faminst.Id.ToString()
			uniqueid = faminst.UniqueId
    	
			boptions = Autodesk.Revit.DB.SpatialElementBoundaryOptions()
			boundsegs = room.GetBoundarySegments(boptions)
			boundcurves = []
			for bound in boundsegs:
				crvs = []
				for seg in bound:
					crv = seg.GetCurve()
					crvs.append(Revit.GeometryConversion.RevitToProtoCurve.ToProtoType( crv, True ))
				boundcurves.append(crvs)
    	
			rooms.append(room)
			names.append(roomname)
			numbers.append(number)
			areas.append(area)
			levels.append(level)
			boundaries.append(boundcurves)
			areaschemes.append(areascheme)
			locations.append(location)
			elementids.append(elementid)
			uniqueids.append(uniqueid)
        
	output.append(rooms)
	output.append(names)
	output.append(numbers)
	output.append(areas)
	output.append(levels)
	output.append(locations)
	output.append(boundaries)
	output.append(areaschemes)
	output.append(elementids)
	output.append(uniqueids)
        
#Assign your output to the OUT variable
OUT = output
# ----------------------------------------

# group: Get Values from revit to populate input form
code_block = CodeBlock()
# ---------- code_block.designscript (2 lines) ----------
"Final Warning";
"When you hit 'Start Calculation', any loads for the floors in the mapping which are not listed as 'Do Not Modify' and you selected as set for overwriting will be erased.";
# ----------------------------------------
ui_textnote_data = Custom[UI.TextNote Data](Title=code_block.out0, TextNote=code_block.out1)  # Create Data for TextNote input in UI.MultipleInputForm ++ . Check out www.data-shapes.net for more informations
code_block_2 = CodeBlock { "Please Select the unit type you have entered from the list available in Revit."; }
python_script_2 = Python()
# ---------- python_script_2.python (13 lines) ----------
import clr
clr.AddReference('ProtoGeometry')
from Autodesk.DesignScript.Geometry import *
clr.AddReference('RevitAPI')
from Autodesk.Revit.DB import *
#The inputs to this node will be stored as a list in the IN variables.
dataEnteringNode = IN

#Assign your output to the OUT variable.
con = []
for DUT in UnitUtils.GetValidDisplayUnits():
	con.append(UnitUtils.GetTypeCatalogString(DUT))
OUT = con
# ----------------------------------------
code_block_3 = CodeBlock { {60..63,136..146}; }
getItemAtIndex = List.GetItemAtIndex(list=python_script_2, index=code_block_3)
flatten = Flatten(getItemAtIndex)
python_script_3 = Python()
# ---------- python_script_3.python (13 lines) ----------
import clr
clr.AddReference('ProtoGeometry')
from Autodesk.DesignScript.Geometry import *
clr.AddReference('RevitAPI')
from Autodesk.Revit.DB import *
#The inputs to this node will be stored as a list in the IN variables.
dataEnteringNode = IN

#Assign your output to the OUT variable.
con = []
for DUT in UnitUtils.GetValidDisplayUnits():
	con.append(UnitUtils.ConvertToInternalUnits(1, DUT))
OUT = con
# ----------------------------------------
getItemAtIndex_2 = List.GetItemAtIndex(list=python_script_3, index=code_block_3)
flatten_2 = Flatten(getItemAtIndex_2)
code_block_4 = CodeBlock { 1; }
ui_radiobuttons_data = Custom[UI.RadioButtons Data](InputName=code_block_2, Keys=flatten, Values=flatten_2, DefaultValueIndex=code_block_4)  # Create radio buttons input for UI.MultipleInputForm ++ .
code_block_5 = CodeBlock { "Curve Resolution as a length in display units.\n Curve will be split into segments shorter than this length with a minimum segment count of 10"; }
code_block_6 = CodeBlock { 1; }
python_script_4 = Python()
# ---------- python_script_4.python (21 lines) ----------
import clr
clr.AddReference('ProtoGeometry')
from Autodesk.DesignScript.Geometry import *
clr.AddReference('RevitAPI')
from Autodesk.Revit.DB import *
#Import DocumentManager
clr.AddReference('RevitServices')
import RevitServices
from RevitServices.Persistence import DocumentManager

doc = DocumentManager.Instance.CurrentDBDocument

#Assign your output to the OUT variable.
con = []
con = UnitUtils.ConvertToInternalUnits(500, DisplayUnitType.DUT_MILLIMETERS)

getDocUnits = doc.GetUnits()
getDisplayUnits = getDocUnits.GetFormatOptions(UnitType.UT_Length).DisplayUnits

con = UnitUtils.ConvertFromInternalUnits(con, getDisplayUnits)
OUT = con
# ----------------------------------------
python_script_5 = Python()
# ---------- python_script_5.python (21 lines) ----------
import clr
clr.AddReference('ProtoGeometry')
from Autodesk.DesignScript.Geometry import *
clr.AddReference('RevitAPI')
from Autodesk.Revit.DB import *
#Import DocumentManager
clr.AddReference('RevitServices')
import RevitServices
from RevitServices.Persistence import DocumentManager

doc = DocumentManager.Instance.CurrentDBDocument

#Assign your output to the OUT variable.
con = []
con = UnitUtils.ConvertToInternalUnits(100, DisplayUnitType.DUT_MILLIMETERS)

getDocUnits = doc.GetUnits()
getDisplayUnits = getDocUnits.GetFormatOptions(UnitType.UT_Length).DisplayUnits

con = UnitUtils.ConvertFromInternalUnits(con, getDisplayUnits)
OUT = con
# ----------------------------------------
slider = Custom[UI.Slider](InputName=code_block_5, Minimum=code_block_6, Maximum=python_script_4, Default_Value=python_script_5, Step=code_block_6)  # Creates slider input for UI.MultipleInputForm ++ . Set the step to decimal value if you want a double slider, or to a integer value if you want an integer slider.
code_block_7 = CodeBlock { "Minimum Room Boundary Length. Handles Error from misdrawn Lines. \n A line shorter than this distance is considered a modelling error and will be removed. If it wasn't an error, it is fixed by the python script slightly further down."; }
code_block_8 = CodeBlock { 1; }
python_script_6 = Python()  # same code as python_script_5
python_script_7 = Python()
# ---------- python_script_7.python (21 lines) ----------
import clr
clr.AddReference('ProtoGeometry')
from Autodesk.DesignScript.Geometry import *
clr.AddReference('RevitAPI')
from Autodesk.Revit.DB import *
#Import DocumentManager
clr.AddReference('RevitServices')
import RevitServices
from RevitServices.Persistence import DocumentManager

doc = DocumentManager.Instance.CurrentDBDocument

#Assign your output to the OUT variable.
con = []
con = UnitUtils.ConvertToInternalUnits(50, DisplayUnitType.DUT_MILLIMETERS)

getDocUnits = doc.GetUnits()
getDisplayUnits = getDocUnits.GetFormatOptions(UnitType.UT_Length).DisplayUnits

con = UnitUtils.ConvertFromInternalUnits(con, getDisplayUnits)
OUT = con
# ----------------------------------------
slider_2 = Custom[UI.Slider](InputName=code_block_7, Minimum=code_block_8, Maximum=python_script_6, Default_Value=python_script_7, Step=code_block_8)

# group: Warning information
categories = Categories("LoadCases")
all_elements_of_category = ElementsOfCategory(categories)
element_types = ElementTypes("AreaLoad")
all_elements_of_type = ElementsOfType(element_types)
code_block_9 = CodeBlock { "Load Case"; }
getParameterValueByName = Element.GetParameterValueByName(element=all_elements_of_type, parameterName=code_block_9)
uniqueItems = List.UniqueItems(getParameterValueByName)
code_block_10 = CodeBlock()
# ---------- code_block_10.designscript (2 lines) ----------
"Warning";
"By Ticking the warning as yes, you agree that you understand floors which are mapped to an area loading plan will have existing area loads on that floor deleted.";
# ----------------------------------------
ui_textnote_data_2 = Custom[UI.TextNote Data](Title=code_block_10.out0, TextNote=code_block_10.out1)
code_block_11 = CodeBlock { "I agree to delete loads on the mapped floors"; false; }
ui_boolean_input = Custom[UI.Boolean input](InputName=code_block_11.out0, DefaultValue=code_block_11.out1)  # Creates a boolean input for UI.MultipleInputForm ++ . Check out www.data-shapes.net for more infos!
code_block_12 = CodeBlock()
# ---------- code_block_12.designscript (2 lines) ----------
"Available Load Cases";
"The following is a list of available load cases to map to. If the load case you wish to use is not on the list, please go to 'Analyse>Analytical Model>Load Cases' and modify the list to suit your project.\n\n";
# ----------------------------------------
code_block_13 = CodeBlock { "\n                                         -"; }
name = Element.Name(all_elements_of_category)
join = String.Join(code_block_13, code_block_12.out1, name)
join_2 = String.Join(code_block_13, join)
ui_textnote_data_3 = Custom[UI.TextNote Data](Title=code_block_12.out0, TextNote=join_2)
code_block_14 = CodeBlock { "Overwrite Loads?"; }
name_2 = Element.Name(uniqueItems)
count = List.Count(uniqueItems)
code_block_15 = CodeBlock(x=count) { x*25+50; }
ui_listview_data = Custom[UI.Listview Data](InputName=code_block_14, Keys=name_2, Values=uniqueItems, Height_optionnal=code_block_15)  # Create data for ListView input in UI.MultiInputForm ++ . Check out www.data-shapes.net for more infos.

# group: Get Levels that are Mapped to
categories_2 = Categories("Levels")
all_elements_of_category_2 = ElementsOfCategory(categories_2)
code_block_16 = CodeBlock(all_elements_of_category_2) { Levels.Elevation; }
sortByKey = List.SortByKey(list=all_elements_of_category_2, keys=code_block_16)
code_block_17 = CodeBlock(sortByKey.sorted_list, sortByKey.sorted_keys) { Levels.Name; Elevations; }
byCoordinates = Point.ByCoordinates(z=code_block_17.Elevations)
byOriginNormal = Plane.ByOriginNormal(origin=byCoordinates)

# group: Determine Load Mapping
code_block_18 = CodeBlock(Out_Level=python_script) { Out_Level[4]; }
uniqueItems_2 = List.UniqueItems(code_block_18)
code_block_19 = CodeBlock { "Don't Modify"; }
addItemToFront = List.AddItemToFront(item=code_block_19, list=uniqueItems_2)

# group: Map Floors to Area Plans
# note: Map the Floor to the Area plan associated to the level. Leave blank the floors you don't want to calculate for and it will skip the floor. It also won't delete any loads associated to that floor.
mapping_table = MappingTableUI(code_block_17.out0, addItemToFront)

# group (continued): Determine Load Mapping
indexOf = IndexOf(uniqueItems_2, mapping_table@@L1)
getItemAtIndex_3 = List.GetItemAtIndex(list=uniqueItems_2, index=indexOf)
removeNulls = Lists.Manage.RemoveNulls(getItemAtIndex_3)
allIndicesOf = List.AllIndicesOf(list=code_block_18@L2, item=removeNulls.out0@L1, lacing=Longest)
removeItemAtIndex = List.RemoveItemAtIndex(list=byOriginNormal, indices=removeNulls.out1)

# group: Sanity Check
count_2 = List.Count(removeNulls.out0)
code_block_20 = CodeBlock { 0; }
gt = count_2 > code_block_20

# group: Reset Calculation
boolean_2 = BoolSelector(true)
and_ = gt && boolean_2

# group: Input Units
code_block_21 = CodeBlock { "Warning"; }
file_path = Filename(".\A_Image_Icon.ico")
code_block_22 = CodeBlock { "I have read the Warning"; "I am not ready"; }
code_block_23 = CodeBlock { "Warning"; }
create = List.Create(ui_textnote_data_2, ui_boolean_input, ui_textnote_data_3, ui_listview_data)
flatten_3 = Flatten(create)
ui_inputgroup_data = Custom[UI.InputGroup Data](GroupTitle=code_block_23, Inputs=flatten_3)  # Creates a group of inputs for UI.MultipleInputForm ++ . Check out www.data-shapes.net for more infos !
code_block_24 = CodeBlock { 800; 600; }
ui_multipleinputform = Custom[UI.MultipleInputForm ++](Description_optional=code_block_21, Logo_optional=file_path, ButtonText_optional=code_block_22.out0, Inputs=ui_inputgroup_data, Toggle=and_, CancelButtonText_optional=code_block_22.out1, MaxHeight_optional=code_block_24.out0, Width_optional=code_block_24.out1)  # Create a form with multiple inputs. see www.data-shapes.net for tutorials and infos!
lastItem = List.LastItem(ui_multipleinputform.User_Inputs)
firstItem = List.FirstItem(ui_multipleinputform.User_Inputs)

# group: Specify Data
contains = Contains(lastItem, uniqueItems@L1)
filterByBoolMask = List.FilterByBoolMask(list=uniqueItems, mask=contains)
contains_2 = Contains(filterByBoolMask.out@L2, all_elements_of_category@@L1, lacing=Longest)
filterByBoolMask_2 = List.FilterByBoolMask(list=all_elements_of_category, mask=contains_2)
count_3 = Count(filterByBoolMask_2.out)
code_block_25 = CodeBlock { 0; }
eq = count_3 == code_block_25
python_script_8 = Python(IN[0]=eq, IN[1]=all_elements_of_category, IN[2]=filterByBoolMask_2.out)
# ---------- python_script_8.python (8 lines) ----------
import clr
clr.AddReference('ProtoGeometry')
from Autodesk.DesignScript.Geometry import *
#The inputs to this node will be stored as a list in the IN variables.
if IN[0]:
	OUT = IN[1]
else:
	OUT = IN[2]
# ----------------------------------------
flatten_4 = Flatten(python_script_8)
name_3 = Element.Name(flatten_4)

# group: Get Loading Descriptions
code_block_26 = CodeBlock(Out_Name=python_script) { Out_Name[1]; }
uniqueItems_3 = List.UniqueItems(code_block_26)

# group: Deconstruct Loading String
code_block_27 = CodeBlock { "\n"; }
split = String.Split(uniqueItems_3, code_block_27)
lastItem_2 = List.LastItem(split@@L2)
code_block_28 = CodeBlock { "+"; }
split_2 = String.Split(lastItem_2, code_block_28)

# group: Map Loading Description List
allIndicesOf_2 = List.AllIndicesOf(list=uniqueItems_3@L2, item=code_block_26@@L1, lacing=Longest)
flatten_5 = Flatten(allIndicesOf_2)

# group: Map Loading Descriptions to Floor
getItemAtIndex_4 = List.GetItemAtIndex(list=flatten_5@L2, index=allIndicesOf@@L1, lacing=Longest)

# group: Get Area Loads
element_types_2 = ElementTypes("AreaLoadType")
all_elements_of_type_2 = ElementsOfType(element_types_2)

# group: Add Area Load Types for each Loadcase without one
flatten_6 = Flatten(all_elements_of_type_2)
name_4 = Element.Name(flatten_6)
indexOf_2 = IndexOf(name_4, name_3@@L1)
getItemAtIndex_5 = List.GetItemAtIndex(list=flatten_6, index=indexOf_2)

# group: Map Area Load Type and Load Case to Loading Description
code_block_29 = CodeBlock { " "; }
split_3 = String.Split(split_2, code_block_29)
lastItem_3 = List.LastItem(split_3@@L2)
flatten_7 = Flatten(lastItem_3)
uniqueItems_4 = List.UniqueItems(flatten_7)
allIndicesOf_3 = List.AllIndicesOf(list=uniqueItems_4@L2, item=lastItem_3@@L2, lacing=Longest)
flatten_8 = Flatten(allIndicesOf_3@@L3)

# group: Map Load Names to Analytical Loads
# note: Map the Load name as written in Revit Schedule to the Load Case as you had in Revit Load Cases under Analyze>Analytical Model>Load Cases.
mapping_table_2 = MappingTableUI(uniqueItems_4, name_3)

# group (continued): Map Area Load Type and Load Case to Loading Description
indexOf_3 = IndexOf(name_3, mapping_table_2@@L1)
getItemAtIndex_6 = List.GetItemAtIndex(list=getItemAtIndex_5, index=indexOf_3)
getItemAtIndex_7 = List.GetItemAtIndex(list=getItemAtIndex_6@L2, index=flatten_8@@L1, lacing=Longest)
getItemAtIndex_8 = List.GetItemAtIndex(list=flatten_4, index=indexOf_3)
getItemAtIndex_9 = List.GetItemAtIndex(list=getItemAtIndex_8@L2, index=flatten_8@@L1, lacing=Longest)

# group: Safety Check Inputs are filled
code_block_30 = CodeBlock { -1; }
contains_3 = Contains(indexOf_3, code_block_30)
not_ = Not(contains_3)
count_4 = List.Count(mapping_table)
code_block_31 = CodeBlock { 0; }
gt_2 = count_4 > code_block_31
and_2 = not_ && gt_2
and_3 = and_2 && and_

and_4 = and_3 && firstItem

# group: Begin Calculation
code_block_32 = CodeBlock { "Calculation Parameters"; }
file_path_2 = Filename(".\A_Image_Icon.ico")
code_block_33 = CodeBlock { "Start Calculation"; "Cancel Run"; }
create_2 = List.Create(ui_textnote_data, ui_radiobuttons_data, slider, slider_2)
flatten_9 = Flatten(create_2)
code_block_34 = CodeBlock { 800; 600; }
ui_multipleinputform_2 = Custom[UI.MultipleInputForm ++](Description_optional=code_block_32, Logo_optional=file_path_2, ButtonText_optional=code_block_33.out0, Inputs=flatten_9, Toggle=and_4, CancelButtonText_optional=code_block_33.out1, MaxHeight_optional=code_block_34.out0, Width_optional=code_block_34.out1)

# group: Explode Data
lastItem_4 = List.LastItem(ui_multipleinputform_2.User_Inputs)
code_block_35 = CodeBlock { 1; }
getItemAtIndex_10 = List.GetItemAtIndex(list=ui_multipleinputform_2.User_Inputs, index=code_block_35)
firstItem_2 = List.FirstItem(ui_multipleinputform_2.User_Inputs)

# group: Fix Curve Geometry
code_block_36 = CodeBlock(Out_Boundaries=python_script) { Out_Boundaries[6]; }
group_curves = Custom[Group Curves](Curves=code_block_36@@L2)  # This node will take any input of flat list of curves and group them into sublists containing "joinable" curves that is continous curves. They might form closed curves or open curves. Use PolyCurve.ByJoinedCurves to convert output groups of curves into single PolyCurves
length = Curve.Length(group_curves@@L2)
ge = length >= lastItem_4
filterByBoolMask_3 = List.FilterByBoolMask(list=group_curves, mask=ge)
group_curves_2 = Custom[Group Curves](Curves=filterByBoolMask_3.in@@L2)
byJoinedCurves = PolyCurve.ByJoinedCurves(group_curves_2@@L2)
flatten_10 = Flatten(byJoinedCurves@@L4)
python_script_9 = Python(IN[0]=flatten_10)
# ---------- python_script_9.python (57 lines) ----------
import clr
clr.AddReference('ProtoGeometry')
from Autodesk.DesignScript.Geometry import *
import math
#The inputs to this node will be stored as a list in the IN variables.

FixedList = []


def distance(p1, p2):
	return p1.DistanceTo(p2)

def create_line(p1, p2):
	return Line.ByStartPointEndPoint(p1, p2)

def extract_nearest_point(point, point_list):
	Max_distance = distance(point,point_list[0]) + 100.0
	index = 0
	return_index = 0;
	while index < len(point_list):
		Checked_Distance = distance(point,point_list[index])
		if (Checked_Distance < Max_distance):
			Max_distance = Checked_Distance
			return_index = index
		index = index + 1;
	return point_list[return_index], point_list[:return_index]+point_list[return_index+1:]

def join_points(points):
	if len(points) == 0:
		return []
	else:
		first_point = points[0]
		nearest_point, remaining_points = extract_nearest_point(first_point, points[1:])
		return [create_line(first_point, nearest_point)] + join_points(remaining_points)
		

for CurveGroup in IN[0]:
	if (CurveGroup.Count == 1):
		if (CurveGroup[0].IsClosed):
			FixedList.append(CurveGroup)
		else:
			FixedList.append(CurveGroup + [create_line(CurveGroup[0].StartPoint,CurveGroup[0].EndPoint)])
	else:
		PointList = []
		for Curve in CurveGroup:
			if not (Curve.IsClosed):
				PointList.append(Curve.StartPoint)
				PointList.append(Curve.EndPoint)
		new_lines = join_points(PointList)
		for i in PointList:
			i.Dispose()
		FixedList.append(CurveGroup + new_lines)
		
		

#Assign your output to the OUT variable.
OUT = FixedList
# ----------------------------------------
group_curves_3 = Custom[Group Curves](Curves=python_script_9@@L2)
byJoinedCurves_2 = PolyCurve.ByJoinedCurves(group_curves_3@@L2)
byPatch = Surface.ByPatch(byJoinedCurves_2@@L2)
area = Surface.Area(byPatch@@L2)
code_block_37 = CodeBlock { false; }
sortIndexByValue = SortIndexByValue(area@@L2, code_block_37)
getItemAtIndex_11 = List.GetItemAtIndex(list=byJoinedCurves_2@L2, index=sortIndexByValue@@L2)
curves = PolyCurve.Curves(getItemAtIndex_11@@L2)
code_block_38 = CodeBlock(Curv=curves, length=getItemAtIndex_10) { ToLines(Curv,length); }
count_5 = List.Count(code_block_38@@L2)
flatten_11 = Flatten(count_5)
code_block_39 = CodeBlock { 1; }
contains_4 = Contains(flatten_11, code_block_39)
code_block_40 = CodeBlock(reduce=contains_4) { reduce?1:0; }
flatten_12 = List.Flatten(list=code_block_38@@L3, amt=code_block_40)

# group: Map Area Loads onto correct planes
getItemAtIndex_12 = List.GetItemAtIndex(list=flatten_12@L4, index=allIndicesOf@@L1, lacing=Longest)
pullOntoPlane = Curve.PullOntoPlane(curve=getItemAtIndex_12@@L4, plane=removeItemAtIndex@L1, lacing=Longest)
code_block_41 = CodeBlock { 1; }
flatten_13 = List.Flatten(list=pullOntoPlane, amt=code_block_41)

# group: Push Curves to Revit
python_script_10 = Python(IN[0]=flatten_13)
# ---------- python_script_10.python (27 lines) ----------
import clr

clr.AddReference('RevitAPI')
from Autodesk.Revit.DB import *

clr.AddReference("RevitNodes")
import Revit
# Import ToProtoType, ToRevitType geometry conversion extension methods
clr.ImportExtensions(Revit.GeometryConversion)


Crv = IN[0]
newList = []

for curvelist in Crv:
	elementlist = []
	for i in curvelist:
		subList = []
		for j in i:
			subList.append(j.ToRevitType())
		elementlist.append(subList)
	newList.append(elementlist)
			



OUT = newList
# ----------------------------------------

# group (continued): Safety Check Inputs are filled
not_2 = Not(ui_multipleinputform_2.Was_Cancelled)
and_5 = ui_multipleinputform_2.Was_Run && not_2
and_6 = and_4 && and_5

# group: Delete Old
string_from_object = FromObject(and_6)
clear_floors = Python(IN[0]=string_from_object)
# ---------- clear_floors.python (29 lines) ----------
import clr

clr.AddReference('RevitAPI')
from Autodesk.Revit.DB import *
from Autodesk.Revit.DB.Structure import *

clr.AddReference('RevitAPIUI')
from Autodesk.Revit.UI import *

clr.AddReference('System')
from System.Collections.Generic import List

clr.AddReference('RevitNodes')
import Revit
clr.ImportExtensions(Revit.GeometryConversion)
clr.ImportExtensions(Revit.Elements)

clr.AddReference('RevitServices')
import RevitServices
from RevitServices.Persistence import DocumentManager
from RevitServices.Transactions import TransactionManager


doc =  DocumentManager.Instance.CurrentDBDocument
Areas = "Nothing"
if IN[0] == "true":
	Areas = FilteredElementCollector(doc).OfCategory(BuiltInCategory.OST_AreaLoads).ToElements()

OUT = Areas
# ----------------------------------------
code_block_42 = CodeBlock { "Load Case"; }
getParameterValueByName_2 = Element.GetParameterValueByName(element=clear_floors, parameterName=code_block_42)
contains_5 = Contains(lastItem, getParameterValueByName_2@L1)
code_block_43 = CodeBlock(removeItemAtIndex) { Planes.Origin.Z; }
geometry = Element.Geometry(clear_floors)
byGeometry = BoundingBox.ByGeometry(geometry)
code_block_44 = CodeBlock(byGeometry) { BB.MinPoint.Z; }
contains_6 = Contains(code_block_43, code_block_44@L1)
and_7 = contains_5 && contains_6
filterByBoolMask_4 = List.FilterByBoolMask(list=clear_floors, mask=and_7)

delete = Archilab.Grimshaw.Elements.Element.Delete(filterByBoolMask_4.in)

# group: Pause
code_block_45 = CodeBlock(RevitCurves=python_script_10, Deleted=delete) { RevitCurves; Deleted; }

# group: Determine Magnitude
python_script_11 = Python(IN[0]=split_2)
# ---------- python_script_11.python (10 lines) ----------
import re

resultingNum = []
for number in IN[0]:
	Lists = []
	for values in number:
		Lists.append(re.findall(r'([\d*\.]+)', values))
	resultingNum.append(Lists)

OUT = resultingNum
# ----------------------------------------
toNumber = String.ToNumber(python_script_11)
flatten_14 = Flatten(toNumber@@L3)
mul = flatten_14 * firstItem_2  # lacing=Longest
code_block_46 = CodeBlock(x=mul) { -Math.Abs(x); }

# group: Map Loading Values to Areas
getItemAtIndex_13 = List.GetItemAtIndex(list=code_block_46@L3, index=getItemAtIndex_4@L1, lacing=Longest)
getItemAtIndex_14 = List.GetItemAtIndex(list=getItemAtIndex_7@L3, index=getItemAtIndex_4@L1, lacing=Longest)

# group: Create Area Loads
python_script_12 = Python(IN[0]=code_block_45.RevitCurves, IN[1]=getItemAtIndex_13, IN[2]=getItemAtIndex_14)
# ---------- python_script_12.python (78 lines) ----------
import clr
clr.AddReference('ProtoGeometry')
from Autodesk.DesignScript.Geometry import *
#Import ToDSType(bool) extension method
clr.AddReference('RevitNodes')
import Revit
clr.ImportExtensions(Revit.GeometryConversion)
#Import DocumentManager and TransactionManager
clr.AddReference('RevitServices')
import RevitServices
from RevitServices.Persistence import DocumentManager
from RevitServices.Transactions import TransactionManager
from System.Collections.Generic import *
#import RevitAPI
clr.AddReference('RevitAPI')
import Autodesk
from Autodesk.Revit.DB import *
from Autodesk.Revit.DB.Structure import *
from System.Collections.Generic import *


doc = DocumentManager.Instance.CurrentDBDocument
uiapp = DocumentManager.Instance.CurrentUIApplication
app = uiapp.Application


lista = IN[0]

profileLoops = []


for l in lista:
	if len(l)>1:
		oP = l[0]
		iP = l[1:]
		outerProfileLoop = CurveLoop()
		ip = []
		loops = [outerProfileLoop]
		profileLoops.append(loops)	
		for i in oP:
			outerProfileLoop.Append(i)
		for j in iP:
			innerProfileLoop = CurveLoop()
			loops.append(innerProfileLoop)
			for i in j:
				innerProfileLoop.Append(i)					
	else:
		oP = l[0]
		outerProfileLoop = CurveLoop()
		profileLoops.Add([outerProfileLoop])
		for i in oP:
			outerProfileLoop.Append(i)
	

F=IN[1]

loadtype = IN[2]

TransactionManager.Instance.EnsureInTransaction(doc)

loads=[]


for Loop_Index in range(0,len(profileLoops)):
#for Loop_Index in range(0,20):
	listLoad = []
	loads.append(listLoad)
	for Load_Index in range(0,len(loadtype[Loop_Index])):
		try:
			listLoad.append(AreaLoad.Create(doc,profileLoops[Loop_Index],XYZ(0.0,0.0,F[Loop_Index][Load_Index]),UnwrapElement(loadtype[Loop_Index][Load_Index])))
		except:
			listLoad.append([])


TransactionManager.Instance.TransactionTaskDone()

#Assign your outputs to the OUT variable
OUT = loads
# ----------------------------------------

# group: Modify Area Load Information
code_block_47 = CodeBlock { "Description"; }
getItemAtIndex_15 = List.GetItemAtIndex(list=lastItem_3@L3, index=getItemAtIndex_4@L1, lacing=Longest)
setParameterByName = Element.SetParameterByName(element=python_script_12, parameterName=code_block_47, value=getItemAtIndex_15)
code_block_48 = CodeBlock { "Load Case"; }
getItemAtIndex_16 = List.GetItemAtIndex(list=getItemAtIndex_9@L3, index=getItemAtIndex_4@L1, lacing=Longest)
setParameterByName_2 = Element.SetParameterByName(element=python_script_12, parameterName=code_block_48, value=getItemAtIndex_16)

# group: For Debug
isEmpty = List.IsEmpty(python_script_12@@L2)
filterByBoolMask_5 = List.FilterByBoolMask(list=flatten_13@@L3, mask=isEmpty@L2)

# group: Errors
# note: Any areas for which rooms loads cannot be added will be diplayed using the code block.
code_block_49 = CodeBlock(Errors=filterByBoolMask_5.in) { Errors; }

# group: DesignScript Code Block
code_block_50 = CodeBlock()
# ---------- code_block_50.designscript (13 lines) ----------
def SplitCurve(Crv:Curve, Len:double)
{
 output = 0;
 return = [Imperative]
 {
  counter = Math.Ceiling(Crv.Length/Len)+1;
  counter = Math.Max(counter,11);
  params = 0..1..#counter;
  PointList = Crv.PointAtParameter(params);
  Poly = PolyCurve.ByPoints(PointList);
  return = Poly.Curves();
 }
};
# ----------------------------------------
code_block_51 = CodeBlock()
# ---------- code_block_51.designscript (16 lines) ----------
def ToLines(Crv:Curve, Len:double)
{
 output = 0;
 return = [Imperative]
 {
  if (Crv.Length != CrvLine(Crv))
  {
   output = SplitCurve(Crv,Len);
  }
  else
  {
   output = Crv;
  }
  return = output;
 }
};
# ----------------------------------------
code_block_52 = CodeBlock()
# ---------- code_block_52.designscript (7 lines) ----------
def CrvLine(Crv:Curve)
{
 return = [Imperative]
 {
  return = Crv.StartPoint.DistanceTo(Crv.EndPoint);
 }
};
# ----------------------------------------

code_block_53 = CodeBlock()
# ---------- code_block_53.designscript (25 lines) ----------
/*
NOTES

Script converts area plans into loading plan for analysis purposes.
Requires user to draw in areas and fill out Area Loading Schedule.

WRITTEN BY  - Predrag Jovanovic
     Giovanni Brogiolo
     Christopher Ho
DYNAMO VERSION - 1.3.2.2480
PACKAGES  - Archilab
    - Data-Shapes   (Main UI)
    - DesignDoExplicit (Custom written by Matteo
          Cominetti in London)
REVIT TEMPLATE - Custom (to be implemented)
LAST UPDATED - 05-03-2018

FUTURE IMPROVEMENTS:
 -  Do not require a specific template (Such as autocreation of
  key schedule and initial Area Load Type)
 - Use the floor surface for the load rather than level
 - Handle buildings whose areas are completely defined by curves.
 - Automatic detection of units.
 - Fix up issue of data-shapes popping up twice
*/;
# ----------------------------------------

# group: Create Area Load Types to match the Load Case List
element_types_3 = ElementTypes("AreaLoadType")
all_elements_of_type_3 = ElementsOfType(element_types_3)
name_5 = Element.Name(all_elements_of_type_3)
contains_7 = Contains(name_5, name@@L1)
filterByBoolMask_6 = List.FilterByBoolMask(list=name, mask=contains_7)

# group: Create Area Loads
python_script_13 = Python(IN[0]=all_elements_of_type_3, IN[1]=filterByBoolMask_6.out)
# ---------- python_script_13.python (22 lines) ----------
import clr
clr.AddReference('ProtoGeometry')
from Autodesk.DesignScript.Geometry import *

#Import DocumentManager and TransactionManager
clr.AddReference('RevitServices')
import RevitServices
from RevitServices.Persistence import DocumentManager
from RevitServices.Transactions import TransactionManager
from System.Collections.Generic import *

doc = DocumentManager.Instance.CurrentDBDocument
TransactionManager.Instance.EnsureInTransaction(doc)

ALoad = UnwrapElement(IN[0][0])
resulting = []
for Name in IN[1]:
	resulting.append(ALoad.Duplicate(Name))

TransactionManager.Instance.TransactionTaskDone()
#Assign your output to the OUT variable.
OUT = resulting
# ----------------------------------------
