# Dynamo graph Detail_Lines_To_Pipes_Geometry231201.dyn (Dynamo 1.3.0.875)

select_model_elements = DSModelElementsSelection()  # 13 picked in the model
curves = Element.Curves(select_model_elements)
flatten = Flatten(curves)
intersectAll = Curve.IntersectAll(flatten)
code_block = CodeBlock { {0,1}; }
pointAtParameter = Curve.PointAtParameter(param=code_block, lacing=CrossProduct)  # unwired: curve
distanceTo = Geometry.DistanceTo(geometry=intersectAll, other=pointAtParameter, lacing=CrossProduct)
code_block_2 = CodeBlock(a=distanceTo) { a==0; }
countTrue = CountTrue(code_block_2, lacing=Longest)
watch = Watch(countTrue)
flatten_2 = Flatten()  # unwired: arg0
uniqueItems = List.UniqueItems(flatten_2)
watch_2 = Watch(uniqueItems)
flatten_3 = Flatten()  # unwired: arg0

# group: DataShapes UI Inputs
categories = Categories("PipeCurves")
all_elements_of_category = ElementsOfCategory(categories)
code_block_3 = CodeBlock { "Type"; }
getParameterValueByName = Element.GetParameterValueByName(element=all_elements_of_category, parameterName=code_block_3)
categories_2 = Categories("PipingSystem")
all_elements_of_category_2 = ElementsOfCategory(categories_2)
code_block_4 = CodeBlock { "Type"; }
getParameterValueByName_2 = Element.GetParameterValueByName(element=all_elements_of_category_2, parameterName=code_block_4)
uniqueItems_2 = List.UniqueItems(getParameterValueByName_2)
watch_3 = Watch(uniqueItems_2)

code_block_5 = CodeBlock { 1; }
getItemAtIndex = List.GetItemAtIndex(list=getParameterValueByName, index=code_block_5)
getItemAtIndex_2 = List.GetItemAtIndex(list=watch_3, index=code_block_5)
levels = Levels("00")
code_block_6 = CodeBlock { 50; }
byLines = Custom[Pipe.ByLines](Lines=flatten_3, PipeType=getItemAtIndex, SystemType=getItemAtIndex_2, Level=levels, Diameter=code_block_6)  # Creates a pipe by Line, PipeType, SystemType, Level and Diameter
watch_4 = Watch(intersectAll)
code_block_7 = CodeBlock { 10; }
byCenterPointRadius = Sphere.ByCenterPointRadius(centerPoint=watch_4, radius=code_block_7)
flatten_4 = Flatten(byCenterPointRadius)
count = Count(flatten_4)
ofRepeatedItem = List.OfRepeatedItem(item=flatten, amount=count)
watch_5 = Watch(ofRepeatedItem)
watch_6 = Watch()  # unwired: arg0
count_2 = List.Count(watch_6, lacing=Longest)
watch_7 = Watch(count_2)
code_block_8 = CodeBlock { 4; }
eq = watch_7 == code_block_8
filterByBoolMask = List.FilterByBoolMask(list=watch_6, mask=eq)
watch_8 = Watch(filterByBoolMask.in)
count_3 = Count(watch_6)
code_block_9 = CodeBlock(a=count_3) { a*4; }

# group: Crosses
flatten_5 = Flatten(watch_8)
code_block_10 = CodeBlock(a=code_block_9) { 0..a..4; 1..a..4; 2..a..4; 3..a..4; }
getItemAtIndex_3 = List.GetItemAtIndex(list=flatten_5, index=code_block_10.out0)
removeNulls = Lists.Manage.RemoveNulls(getItemAtIndex_3)
watch_9 = Watch(removeNulls)
getItemAtIndex_4 = List.GetItemAtIndex(list=flatten_5, index=code_block_10.out1)
removeNulls_2 = Lists.Manage.RemoveNulls(getItemAtIndex_4)
watch_10 = Watch(removeNulls_2)
getItemAtIndex_5 = List.GetItemAtIndex(list=flatten_5, index=code_block_10.out2)
removeNulls_3 = Lists.Manage.RemoveNulls(getItemAtIndex_5)
watch_11 = Watch(removeNulls_3)
getItemAtIndex_6 = List.GetItemAtIndex(list=flatten_5, index=code_block_10.out3)
removeNulls_4 = Lists.Manage.RemoveNulls(getItemAtIndex_6)
watch_12 = Watch(removeNulls_4)
python_script = Python(IN[0]=watch_9, IN[1]=watch_10, IN[2]=watch_11, IN[3]=watch_12)
# ---------- python_script.python (79 lines) ----------
import clr

clr.AddReference("RevitServices")
import RevitServices
from RevitServices.Persistence import DocumentManager
from RevitServices.Transactions import TransactionManager
doc = DocumentManager.Instance.CurrentDBDocument

clr.AddReference("RevitAPI")
from Autodesk.Revit.DB import *

clr.AddReference("RevitNodes")
import Revit
clr.ImportExtensions(Revit.Elements)
clr.ImportExtensions(Revit.GeometryConversion)

if isinstance(IN[0], list):
	pipe1 = UnwrapElement(IN[0])
else:
	pipe1 = [UnwrapElement(IN[0])]
if isinstance(IN[1], list):
	pipe2 = UnwrapElement(IN[1])
else:
	pipe2 = [UnwrapElement(IN[1])]
if isinstance(IN[2], list):
	pipe3 = UnwrapElement(IN[2])
else:
	pipe3 = [UnwrapElement(IN[2])]
if isinstance(IN[3], list):
	pipe4 = UnwrapElement(IN[3])
else:
	pipe4 = [UnwrapElement(IN[3])]

def closest_connectors(pipe1, pipe2,pipe3, pipe4):
	conn1 = pipe1.ConnectorManager.Connectors
	conn2 = pipe2.ConnectorManager.Connectors
	conn3 = pipe3.ConnectorManager.Connectors
	conn4 = pipe4.ConnectorManager.Connectors
	
	dist1 = 100000000
	dist2 = 100000000
	dist3 = 100000000
	connset = []
	for c in conn1:
		for d in conn2:
			conndist = c.Origin.DistanceTo(d.Origin)
			if conndist < dist1:
				dist1 = conndist
				c1 = c
				d1 = d
		for e in conn3:
			conndist = c.Origin.DistanceTo(e.Origin)
			if conndist < dist2:
				dist2 = conndist
				e1 = e
		for f in conn4:
			conndist = c.Origin.DistanceTo(f.Origin)
			if conndist < dist3:
				dist3 = conndist
				f1 = f
		connset = [c1,d1,e1,f1]
	return connset

	
fittings = []
TransactionManager.Instance.EnsureInTransaction(doc)
for p1,p2,p3,p4 in zip(pipe1,pipe2,pipe3,pipe4):
	connectors = closest_connectors(p1,p2,p3,p4)
	try:
		fitting = doc.Create.NewCrossFitting(connectors[0],connectors[1],connectors[2],connectors[3])
		fittings.append(fitting.ToDSType(False))
	except:
		fittings.append(None)
		
TransactionManager.Instance.TransactionTaskDone()

			

OUT = fittings
# ----------------------------------------
watch_13 = Watch(python_script)

code_block_11 = CodeBlock { 2; }
eq_2 = watch_7 == code_block_11
filterByBoolMask_2 = List.FilterByBoolMask(list=watch_6, mask=eq_2)
watch_14 = Watch(filterByBoolMask_2.in)

# group: Elbow
flatten_6 = Flatten(watch_14)
code_block_12 = CodeBlock { 1000; }
byMEPCurves = Custom[Elbow.ByMEPCurves](MEPCurves=flatten_6, Margin=code_block_12)  # Takes in a list of MEPCurves (pipe, duct, cable tray, conduit) and will attempt to create elbows where possible. A margin can be entered for max distance between connectors
watch_15 = Watch(byMEPCurves)

code_block_13 = CodeBlock { 3; }
eq_3 = watch_7 == code_block_13
filterByBoolMask_3 = List.FilterByBoolMask(list=watch_6, mask=eq_3)
watch_16 = Watch(filterByBoolMask_3.in)

# group: Tee
flatten_7 = Flatten(watch_16)
code_block_14 = CodeBlock(a=code_block_9) { 0..a..3; 1..a..3; 2..a..3; }
getItemAtIndex_7 = List.GetItemAtIndex(list=flatten_7, index=code_block_14.out1)
removeNulls_5 = Lists.Manage.RemoveNulls(getItemAtIndex_7)
flatten_8 = Flatten(removeNulls_5)
watch_17 = Watch(flatten_8)
getItemAtIndex_8 = List.GetItemAtIndex(list=flatten_7, index=code_block_14.out2)
removeNulls_6 = Lists.Manage.RemoveNulls(getItemAtIndex_8)
flatten_9 = Flatten(removeNulls_6)
watch_18 = Watch(flatten_9)
getItemAtIndex_9 = List.GetItemAtIndex(list=flatten_7, index=code_block_14.out0)
removeNulls_7 = Lists.Manage.RemoveNulls(getItemAtIndex_9)
flatten_10 = Flatten(removeNulls_7)
watch_19 = Watch(flatten_10)
byMEPCurves_2 = Custom[Tee.By3MEPCurves](MEPCurve1=watch_17, MEPCurve2=watch_18, MEPCurve3=watch_19)  # "Tee.ByMEPCurves"; Creates a new Tee fitting for the 3 input MEP curves (conduit, cable tray, duct or pipe). Only works with a perpendicular branch MEPCurve
watch_20 = Watch(byMEPCurves_2)
watch_21 = Watch(getItemAtIndex_8)
watch_22 = Watch(code_block_14.out2)

code_block_15 = CodeBlock { HERE SP:ITS!??£!"£ }
splitByPoints = Curve.SplitByPoints()  # unwired: curve, points
flatten_11 = Flatten(splitByPoints)
length = Curve.Length(flatten_11)
removeNulls_8 = Lists.Manage.RemoveNulls(length)
removeItemAtIndex = List.RemoveItemAtIndex(list=flatten_11, indices=removeNulls_8.out1)
code_block_16 = CodeBlock(a=removeNulls_8.out0) { a>1; }
filterByBoolMask_4 = List.FilterByBoolMask(list=removeItemAtIndex, mask=code_block_16)
code_block_17 = CodeBlock(a=filterByBoolMask_4.in) { a; }
doesIntersect = Geometry.DoesIntersect(geometry=flatten_4, other=flatten_3, lacing=CrossProduct)
filterByBoolMask_5 = List.FilterByBoolMask(list=flatten_3, mask=doesIntersect)
doesIntersect_2 = Geometry.DoesIntersect(geometry=flatten_4, other=flatten, lacing=CrossProduct)
watch_23 = Watch(doesIntersect_2)
filterByBoolMask_6 = List.FilterByBoolMask(list=ofRepeatedItem, mask=watch_23)
code_block_18 = CodeBlock(a=filterByBoolMask_6.in) { a; }
code_block_19 = CodeBlock(a=intersectAll) { a; }
python_script_2 = Python(IN[0]=code_block_19)
# ---------- python_script_2.python (12 lines) ----------
import clr
clr.AddReference('ProtoGeometry')
from Autodesk.DesignScript.Geometry import *
#The inputs to this node will be stored as a list in the IN variables.
pts = IN[0]
outPts = []

for p in pts:
	outPts.append([p])

#Assign your output to the OUT variable.
OUT = outPts
# ----------------------------------------
splitByPoints_2 = Curve.SplitByPoints(curve=code_block_18, points=python_script_2, lacing=Longest)
