# Dynamo graph Detail_Lines_To_Pipes_Geometry_UI_1.dyn (Dynamo 1.3.1.1736)

select_model_elements = DSModelElementsSelection()  # 11 picked in the model
watch = Watch(select_model_elements)
watch_2 = Watch(watch)
watch_3 = Watch(watch_2)
code_block = CodeBlock { {0,1000}; }

# group: Adds Z Axis
watch_4 = Watch(select_model_elements)
code_block_2 = CodeBlock { "Line Style"; }
getParameterValueByName = Element.GetParameterValueByName(element=watch_4, parameterName=code_block_2)
name = Parameter.Name(getParameterValueByName)
uniqueItems = List.UniqueItems(name)
allIndicesOf = List.AllIndicesOf(list=name, item=uniqueItems)
getItemAtIndex = List.GetItemAtIndex(list=watch_4, index=allIndicesOf)
watch_5 = Watch(getItemAtIndex)
curves = Element.Curves(watch_5)
flatten = Flatten(curves@L3)
watch_6 = Watch(flatten)
ZAxis = Vector.ZAxis()
translate = Geometry.Translate(geometry=watch_6, direction=ZAxis, distance=code_block)
code_block_3 = CodeBlock { 0; }

# group: SPLIT EACH LINE USING ONLY THE POINTS THAT BELONG TO THAT LINE
flatten_2 = Flatten(translate)
intersectAll = Curve.IntersectAll(flatten_2)
doesIntersect = Geometry.DoesIntersect(geometry=flatten_2, other=intersectAll, lacing=CrossProduct)
filterByBoolMask = List.FilterByBoolMask(list=intersectAll@@L2, mask=doesIntersect, lacing=Longest)
splitByPoints = Curve.SplitByPoints(curve=flatten_2, points=filterByBoolMask.in)

count = Count(splitByPoints@L2)
cycle = List.Cycle(list=watch_3, amount=count, lacing=Longest)
watch_7 = Watch(cycle)

# group: DataShapes UI Inputs
code_block_4 = CodeBlock { "Line Style"; }
getParameterValueByName_2 = Element.GetParameterValueByName(element=watch_7, parameterName=code_block_4)
watch_8 = Watch(getParameterValueByName_2)
categories = Categories("PipingSystem")
all_elements_of_category = ElementsOfCategory(categories)
code_block_5 = CodeBlock { "Type"; }
getParameterValueByName_3 = Element.GetParameterValueByName(element=all_elements_of_category, parameterName=code_block_5)
uniqueItems_2 = List.UniqueItems(getParameterValueByName_3)
watch_9 = Watch(uniqueItems_2)
code_block_6 = CodeBlock { "Type Name"; }
getParameterValueByName_4 = Element.GetParameterValueByName(element=watch_9, parameterName=code_block_6)
uniqueItems_3 = List.UniqueItems(getParameterValueByName_4)
categories_2 = Categories("PipeCurves")
all_elements_of_category_2 = ElementsOfCategory(categories_2)
code_block_7 = CodeBlock { "Type"; }
getParameterValueByName_5 = Element.GetParameterValueByName(element=all_elements_of_category_2, parameterName=code_block_7)
uniqueItems_4 = List.UniqueItems(getParameterValueByName_5)
name_2 = Parameter.Name(uniqueItems_4)

flatten_3 = Flatten(watch_8)

# group (continued): DataShapes UI Inputs
uniqueItems_5 = List.UniqueItems(flatten_3)
name_3 = Parameter.Name(uniqueItems_5)
watch_10 = Watch(name_3)

flatten_4 = Flatten(watch_10)
ui_dropdown_data = Custom[UI.DropDown Data](InputName=flatten_4, Keys=uniqueItems_3, Values=uniqueItems_3)  # Create data for DropDown input in UI.MultiInputForm ++ . Check out www.data-shapes.net for more infos.
ui_dropdown_data_2 = Custom[UI.DropDown Data](InputName=flatten_4, Keys=name_2, Values=name_2)
create = List.Create(ui_dropdown_data, ui_dropdown_data_2)
flatten_5 = Flatten(create)
boolean = BoolSelector(true)
ui_multipleinputform = Custom[UI.MultipleInputForm ++](Inputs=flatten_5, Toggle=boolean)  # Create a form with multiple inputs. see www.data-shapes.net for tutorials and infos!
watch_11 = Watch(ui_multipleinputform.User_Inputs)
code_block_8 = CodeBlock { "Line Style"; }
getParameterValueByName_6 = Element.GetParameterValueByName(element=select_model_elements, parameterName=code_block_8)
name_4 = Element.Name(getParameterValueByName_6)
allIndicesOf_2 = List.AllIndicesOf(list=watch_10, item=name_4)
watch_12 = Watch(allIndicesOf_2)
flatten_6 = Flatten(splitByPoints)
watch_13 = Watch(flatten_6)
watch_14 = Watch(watch_13)
code_block_9 = CodeBlock(Lines=watch_14) { Lines; }
watch_15 = Watch(getParameterValueByName_5)
removeNulls = Lists.Manage.RemoveNulls(name_2)
watch_16 = Watch(removeNulls)
watch_17 = Watch(ui_multipleinputform.User_Inputs)
allIndicesOf_3 = List.AllIndicesOf(list=watch_16, item=watch_17)
getItemAtIndex_2 = List.GetItemAtIndex(list=watch_15, index=allIndicesOf_3@L1)
code_block_10 = CodeBlock(PipeTypeList=getItemAtIndex_2) { Flatten(PipeTypeList); }
getItemAtIndex_3 = List.GetItemAtIndex(list=code_block_10, index=allIndicesOf_2@L1)
watch_18 = Watch(getItemAtIndex_3)
allIndicesOf_4 = List.AllIndicesOf(list=uniqueItems_3, item=ui_multipleinputform.User_Inputs)
getItemAtIndex_4 = List.GetItemAtIndex(list=watch_9, index=allIndicesOf_4@L1)
code_block_11 = CodeBlock(SystemTypeList=getItemAtIndex_4) { Flatten(SystemTypeList); }
getItemAtIndex_5 = List.GetItemAtIndex(list=code_block_11, index=allIndicesOf_2@L1)
watch_19 = Watch(getItemAtIndex_5)
levels = Levels("00")
code_block_12 = CodeBlock { 50; }
byLines = Custom[Pipe.ByLines](Lines=code_block_9, PipeType=watch_18, SystemType=watch_19, Level=levels, Diameter=code_block_12, lacing=Longest)  # Creates a pipe by Line, PipeType, SystemType, Level and Diameter
watch_20 = Watch(intersectAll)
code_block_13 = CodeBlock { 10; }
byCenterPointRadius = Sphere.ByCenterPointRadius(centerPoint=watch_20, radius=code_block_13)
flatten_7 = Flatten(byCenterPointRadius)
count_2 = Count(flatten_7)
ofRepeatedItem = List.OfRepeatedItem(item=byLines, amount=count_2)
watch_21 = Watch(ofRepeatedItem)
location = Custom[Element.Location](element=byLines)  # Returns the location of an element as an XYZ (or if it's line-based the start and end point of the line), along with some booleans to help filtering the results. Use this for some element types (e.g. walls or lines) that do not work with the built-in Get Family Instance Location node.
doesIntersect_2 = Geometry.DoesIntersect(geometry=flatten_7, other=location.curves, lacing=CrossProduct)
watch_22 = Watch(doesIntersect_2)
filterByBoolMask_2 = List.FilterByBoolMask(list=ofRepeatedItem, mask=watch_22)
watch_23 = Watch(filterByBoolMask_2.in)
count_3 = List.Count(watch_23, lacing=Longest)
watch_24 = Watch(count_3)
code_block_14 = CodeBlock { 4; }
eq = watch_24 == code_block_14
filterByBoolMask_3 = List.FilterByBoolMask(list=watch_23, mask=eq)
watch_25 = Watch(filterByBoolMask_3.in)
count_4 = Count(watch_23)
code_block_15 = CodeBlock(a=count_4) { a*4; }

# group: Crosses
flatten_8 = Flatten(watch_25)
code_block_16 = CodeBlock(a=code_block_15) { 0..a..4; 1..a..4; 2..a..4; 3..a..4; }
getItemAtIndex_6 = List.GetItemAtIndex(list=flatten_8, index=code_block_16.out0)
removeNulls_2 = Lists.Manage.RemoveNulls(getItemAtIndex_6)
watch_26 = Watch(removeNulls_2)
getItemAtIndex_7 = List.GetItemAtIndex(list=flatten_8, index=code_block_16.out1)
removeNulls_3 = Lists.Manage.RemoveNulls(getItemAtIndex_7)
watch_27 = Watch(removeNulls_3)
getItemAtIndex_8 = List.GetItemAtIndex(list=flatten_8, index=code_block_16.out2)
removeNulls_4 = Lists.Manage.RemoveNulls(getItemAtIndex_8)
watch_28 = Watch(removeNulls_4)
getItemAtIndex_9 = List.GetItemAtIndex(list=flatten_8, index=code_block_16.out3)
removeNulls_5 = Lists.Manage.RemoveNulls(getItemAtIndex_9)
watch_29 = Watch(removeNulls_5)
python_script = Python(IN[0]=watch_26, IN[1]=watch_27, IN[2]=watch_28, IN[3]=watch_29)
# ---------- python_script.python (79 lines) ----------
import clr

clr.AddReference("RevitServices")
import RevitServices
from RevitServices.Persistence import DocumentManager
from RevitServices.Transactions import TransactionManager
doc = DocumentManager.Instance.CurrentDBDocument

clr.AddReference("RevitAPI")
from Autodesk.Revit.DB import *

clr.AddReference("RevitNodes")
import Revit
clr.ImportExtensions(Revit.Elements)
clr.ImportExtensions(Revit.GeometryConversion)

if isinstance(IN[0], list):
	pipe1 = UnwrapElement(IN[0])
else:
	pipe1 = [UnwrapElement(IN[0])]
if isinstance(IN[1], list):
	pipe2 = UnwrapElement(IN[1])
else:
	pipe2 = [UnwrapElement(IN[1])]
if isinstance(IN[2], list):
	pipe3 = UnwrapElement(IN[2])
else:
	pipe3 = [UnwrapElement(IN[2])]
if isinstance(IN[3], list):
	pipe4 = UnwrapElement(IN[3])
else:
	pipe4 = [UnwrapElement(IN[3])]

def closest_connectors(pipe1, pipe2,pipe3, pipe4):
	conn1 = pipe1.ConnectorManager.Connectors
	conn2 = pipe2.ConnectorManager.Connectors
	conn3 = pipe3.ConnectorManager.Connectors
	conn4 = pipe4.ConnectorManager.Connectors
	
	dist1 = 100000000
	dist2 = 100000000
	dist3 = 100000000
	connset = []
	for c in conn1:
		for d in conn2:
			conndist = c.Origin.DistanceTo(d.Origin)
			if conndist < dist1:
				dist1 = conndist
				c1 = c
				d1 = d
		for e in conn3:
			conndist = c.Origin.DistanceTo(e.Origin)
			if conndist < dist2:
				dist2 = conndist
				e1 = e
		for f in conn4:
			conndist = c.Origin.DistanceTo(f.Origin)
			if conndist < dist3:
				dist3 = conndist
				f1 = f
		connset = [c1,d1,e1,f1]
	return connset

	
fittings = []
TransactionManager.Instance.EnsureInTransaction(doc)
for p1,p2,p3,p4 in zip(pipe1,pipe2,pipe3,pipe4):
	connectors = closest_connectors(p1,p2,p3,p4)
	try:
		fitting = doc.Create.NewCrossFitting(connectors[0],connectors[1],connectors[2],connectors[3])
		fittings.append(fitting.ToDSType(False))
	except:
		fittings.append(None)
		
TransactionManager.Instance.TransactionTaskDone()

			

OUT = fittings
# ----------------------------------------
watch_30 = Watch(python_script)

code_block_17 = CodeBlock { 2; }
eq_2 = watch_24 == code_block_17
filterByBoolMask_4 = List.FilterByBoolMask(list=watch_23, mask=eq_2)
watch_31 = Watch(filterByBoolMask_4.in)

# group: Elbow
flatten_9 = Flatten(watch_31)
code_block_18 = CodeBlock { 100; }
byMEPCurves = Custom[Elbow.ByMEPCurves](MEPCurves=flatten_9, Margin=code_block_18)  # Takes in a list of MEPCurves (pipe, duct, cable tray, conduit) and will attempt to create elbows where possible. A margin can be entered for max distance between connectors
watch_32 = Watch(byMEPCurves)

code_block_19 = CodeBlock { 3; }
eq_3 = watch_24 == code_block_19
filterByBoolMask_5 = List.FilterByBoolMask(list=watch_23, mask=eq_3)
watch_33 = Watch(filterByBoolMask_5.in)

# group: Tee
flatten_10 = Flatten(watch_33)
code_block_20 = CodeBlock(a=code_block_15) { 0..a..3; 1..a..3; 2..a..3; }
getItemAtIndex_10 = List.GetItemAtIndex(list=flatten_10, index=code_block_20.out1)
removeNulls_6 = Lists.Manage.RemoveNulls(getItemAtIndex_10)
flatten_11 = Flatten(removeNulls_6)
watch_34 = Watch(flatten_11)
getItemAtIndex_11 = List.GetItemAtIndex(list=flatten_10, index=code_block_20.out2)
removeNulls_7 = Lists.Manage.RemoveNulls(getItemAtIndex_11)
flatten_12 = Flatten(removeNulls_7)
watch_35 = Watch(flatten_12)
getItemAtIndex_12 = List.GetItemAtIndex(list=flatten_10, index=code_block_20.out0)
removeNulls_8 = Lists.Manage.RemoveNulls(getItemAtIndex_12)
flatten_13 = Flatten(removeNulls_8)
watch_36 = Watch(flatten_13)
by3MEPCurves = Custom[Tee.By3MEPCurves](Main_MEPCurve=watch_34, Main_MEPCurve_2=watch_35, Branch_MEPCurve=watch_36)  # Creates a new Tee fitting for the 3 input MEP curves (conduit, cable tray, duct or pipe). Only works with a perpendicular branch MEPCurve
watch_37 = Watch(by3MEPCurves)
watch_38 = Watch(getItemAtIndex_11)
watch_39 = Watch(code_block_20.out2)

watch_40 = Watch(getItemAtIndex_3)
watch_41 = Watch(getItemAtIndex_5)
code_block_21 = CodeBlock { "Line Style"; }
getParameterValueByName_7 = Element.GetParameterValueByName(element=watch_7, parameterName=code_block_21)
watch_42 = Watch(name_2)
watch_43 = Watch(uniqueItems_3)
watch_44 = Watch(allIndicesOf_3)
flatten_14 = Flatten(byLines)  # frozen
watch_45 = Watch(flatten_14)

# group: Offset Control
code_block_22 = CodeBlock { "System Type"; }
getParameterValueByName_8 = Element.GetParameterValueByName(element=watch_45, parameterName=code_block_22)
name_5 = Parameter.Name(getParameterValueByName_8)
uniqueItems_6 = List.UniqueItems(name_5)
code_block_23 = CodeBlock { "Offset"; }
code_block_24 = CodeBlock { 0; 500; 1000; 1500; 2000; 2500; 3000; 3500; 4000; }
create_2 = List.Create(code_block_24.out0, code_block_24.out1, code_block_24.out2, code_block_24.out3, code_block_24.out4, code_block_24.out5, code_block_24.out6, code_block_24.out7, code_block_24.out8)

watch_46 = Watch(getParameterValueByName_8)
flatten_15 = Flatten(name_5)
flatten_16 = Flatten(uniqueItems_6)

# group (continued): Offset Control
allIndicesOf_5 = List.AllIndicesOf(list=flatten_15, item=flatten_16)
getItemAtIndex_13 = List.GetItemAtIndex(list=watch_45, index=allIndicesOf_5)
watch_47 = Watch(getItemAtIndex_13)
setParameterByName = Element.SetParameterByName(element=watch_47@L2, parameterName=code_block_23, value=create_2@L1)
watch_48 = Watch(setParameterByName)

getParameterValueByName_9 = Element.GetParameterValueByName(element=watch_48, parameterName=code_block_23)
watch_49 = Watch(getParameterValueByName_9)
watch_50 = Watch(uniqueItems_6)
watch_51 = Watch(allIndicesOf_5)
watch_52 = Watch(name_5)
watch_53 = Watch(create_2)
flatten_17 = Flatten(watch_48)
watch_54 = Watch(translate)
code_block_25 = CodeBlock { 0; 500; 1000; 1500; 2000; 2500; 3000; 3500; 4000; }
create_3 = List.Create(code_block_25.out0, code_block_25.out1, code_block_25.out2, code_block_25.out3, code_block_25.out4, code_block_25.out5, code_block_25.out6, code_block_25.out7, code_block_25.out8)
watch_55 = Watch(splitByPoints)
code_block_26 = CodeBlock { "Line Style"; }
getParameterValueByName_10 = Element.GetParameterValueByName(element=watch_3, parameterName=code_block_26)
name_6 = Parameter.Name(getParameterValueByName_10)
watch_56 = Watch(name_6)
watch_57 = Watch(count)
