# Dynamo graph DirectShape.dyn (Dynamo 1.3.3.4651)

code_block = CodeBlock { 5000; }
byLengths = Cuboid.ByLengths(width=code_block, length=code_block, height=code_block)
categories = Categories("StructuralFraming")
code_block_2 = CodeBlock { "Metal-Steel-250MPa"; }
byName = Material.ByName(code_block_2)
code_block_3 = CodeBlock { "MyBox"; }
byGeometry = DirectShape.ByGeometry(geometry=byLengths, category=categories, material=byName, name=code_block_3)
