# Dynamo graph Exporter_.dyn (Dynamo 1.3.2.2480)

code_block = CodeBlock { 0; }
code_block_2 = CodeBlock { {"1","2"}; }
string = StringInput("H:\Personal\Scripts\WIP\Schedules\Export\export\test")  # frozen
string_2 = StringInput("H:\Personal\Scripts\WIP\Schedules\Export\export\test2")
create = List.Create(string, string_2)
boolean = BoolSelector(true)
code_block_3 = CodeBlock { {"Test1","Test2"}; }
code_block_4 = CodeBlock { {"A1","D1"}; {"D1","AAA"}; }
bb_data = Custom[BB Data](SheetName=code_block_3, Origin=code_block_4.out0, Data=code_block_4.out1)  # This node is a building block for different modes of writing to Excel files. You can combines this node into a list to write to multiple sheets or use just one to write to a single sheet.
write_excel = Custom[Write Excel](filePath=create, RunIt=boolean, BBData=bb_data)  # This node will write data to Excel file and based on how your BBData nodes are structured it will either override the exsting file, create a new one and write a single worksheet or write multiple worksheets.
watch = Watch(write_excel)
watch_2 = Watch(bb_data)

# group: Get Schedules
categories = Categories("Sheets")
all_elements_of_category = ElementsOfCategory(categories)
code_block_5 = CodeBlock { "Sheet Number"; }
getParameterValueByName = Element.GetParameterValueByName(element=all_elements_of_category, parameterName=code_block_5)
code_block_6 = CodeBlock { "0571"; }
contains = String.Contains(str=getParameterValueByName, searchFor=code_block_6)
filterByBoolMask = List.FilterByBoolMask(list=all_elements_of_category, mask=contains)
code_block_7 = CodeBlock { 0..4..1; }
getItemAtIndex = List.GetItemAtIndex(list=filterByBoolMask.in, index=code_block_7)
watch_3 = Watch(getItemAtIndex)
schedules = Custom[Sheet.Schedules](sheet=watch_3)  # Returns all schedules placed on a specified sheet
watch_4 = Watch(schedules)
code_block_8 = CodeBlock { "Sheet Name"; }
getParameterValueByName_2 = Element.GetParameterValueByName(element=watch_3, parameterName=code_block_8)

fields = ScheduleView.Fields(watch_4)
name = Revit.Schedules.ScheduleField.Name(fields)
watch_5 = Watch(name)
code_block_9 = CodeBlock { {"Identity_Category","Identity_Level","Identity_Reference","Identity_System_Reference","Identity_Plant_Reference","Identity_Level_Reference","Identity_Core_Reference","Identity_Desginated_Reference","Description"}; }
allIndicesOf = List.AllIndicesOf(list=code_block_9, item=watch_5)
flatten = Flatten(allIndicesOf)
removeItemAtIndex = List.RemoveItemAtIndex(list=watch_5@L2, indices=flatten)
watch_6 = Watch(removeItemAtIndex)
getTextFromHeader = Custom[Schedule.GetTextFromHeader](ViewSchedule_List=watch_4@L2)  # from Viewschedule input, returns columns header values as text
watch_7 = Watch(getTextFromHeader)

# group: Sheet Names
watch_8 = Watch(watch_7)
length = String.Length(watch_8)
code_block_10 = CodeBlock { 31; }
code_block_11 = CodeBlock { 31; }
gt = _ > code_block_11  # unwired: arg0
replaceByCondition = Replace(length, code_block_10, gt)
watch_9 = Watch(replaceByCondition)
map = List.Map()  # unwired: list, f_x
code_block_12 = CodeBlock { 0; 31; }
substring = String.Substring(str=watch_8@L2, startIndex=code_block_12.out0, length=replaceByCondition@L2)

watch_10 = Watch()  # unwired: arg0

# group: Maximum Row Value
count = Count(watch_10@L3)  # frozen
watch_11 = Watch(count)

# group: Excel Documents
string_3 = StringInput("H:\Personal\Scripts\WIP\Schedules\Export\export\")
excel_names = Watch(getParameterValueByName_2)
code_block_13 = CodeBlock(a=string_3, b=excel_names) { a+b; }
watch_12 = Watch(code_block_13)
code_block_14 = CodeBlock { 1; }
chop = List.Chop(list=watch_12, lengths=code_block_14)
watch_13 = Watch(chop)

excel_sheet_names = Watch(substring)

# group: Creates and Add Data to Excel
boolean_2 = BoolSelector(true)
boolean_3 = BoolSelector(false)
code_block_15 = CodeBlock { "A1"; }
bb_data_2 = Custom[BB Data](SheetName=excel_sheet_names@L2, Origin=code_block_15, Data=watch_10@L4)  # frozen
write_excel_2 = Custom[Write Excel](filePath=watch_13@L2, RunIt=boolean_2, ByColumn=boolean_3, BBData=bb_data_2@L2)
watch_14 = Watch(write_excel_2)

# group: Starts Formatting Process
code_block_16 = CodeBlock { "Success!"; }
eq = watch_14 == code_block_16
allTrue = AllTrue(eq)

# group: Formatting Attempt
code_block_17 = CodeBlock(R=watch_11) { "A1:A"+R; }
watch_15 = Watch(code_block_17)
watch_16 = Watch(watch_13)
code_block_18 = CodeBlock { "Normal"; }
navy = Custom[Color.Navy]()  # Returns the colour navy.
fill_style = Custom[Fill Style](PatternType=code_block_18, BackgroundColor=navy, PatternColor=navy)  # This node generates a Fill Style that can be used for conditional formatting or regular cell formatting.
graphic_style = Custom[Graphic Style](FillStyle=fill_style)  # This node will create a graphic style that can be used either for conditional formatting or regular cell formatting.
bb_style = Custom[BB Style](SheetName=excel_sheet_names@L1, CellRange=code_block_17, GraphicStyle=graphic_style)  # This node is a building block for different modes of formatting an Excel file. You can combines this node into a list to apply formatting to multiple ranges or sheets at the same time.
watch_17 = Watch(bb_style)
format_excel = Custom[Format Excel](filePath=watch_16@L2, RunIt=allTrue, BB_Style=watch_17)  # This node will allow you to apply formatting to a specific range within the document. You can format a single range on a single sheet or multiple ranges on multiple sheets at the same time.
watch_18 = Watch(format_excel)
watch_19 = Watch(bb_style)
watch_20 = Watch(graphic_style)
watch_21 = Watch(fill_style)

watch_22 = Watch(allTrue)

# group: Test 2
data_Headers = CodeBlock { {1,2,3,4,5,6}; }
code_block_19 = CodeBlock { 10; }
ofRepeatedItem = List.OfRepeatedItem(item=data_Headers, amount=code_block_19)
data_Headers_2 = CodeBlock { {1,2}; }
code_block_20 = CodeBlock { 2; }
ofRepeatedItem_2 = List.OfRepeatedItem(item=data_Headers_2, amount=code_block_20)
create_2 = List.Create(ofRepeatedItem_2, ofRepeatedItem)
watch_23 = Watch(create_2)
data = CodeBlock { {1,4,6}; }
ofRepeatedItem_3 = List.OfRepeatedItem(item=data, amount=code_block_19)
allIndicesOf_2 = List.AllIndicesOf(list=watch_23@L2, item=ofRepeatedItem_3@L2)
code_block_21 = CodeBlock { 2; }
flatten_2 = List.Flatten(list=allIndicesOf_2, amt=code_block_21)
removeItemAtIndex_2 = List.RemoveItemAtIndex(list=ofRepeatedItem@L2, indices=flatten_2)
watch_24 = Watch(removeItemAtIndex_2)
watch_25 = Watch(allIndicesOf_2)
watch_26 = Watch(ofRepeatedItem_3)
watch_27 = Watch(flatten_2)

# group: TEst 1
code_block_22 = CodeBlock { {1,2,"A",3}; }
create_3 = List.Create(code_block_22)
watch_28 = Watch(create_3)
code_block_23 = CodeBlock { 3; }
ofRepeatedItem_4 = List.OfRepeatedItem(item=watch_28, amount=code_block_23)
create_4 = List.Create(ofRepeatedItem_4)
watch_29 = Watch(create_4)
code_block_24 = CodeBlock { {1,2,3}; }
create_5 = List.Create(code_block_24)
watch_30 = Watch(create_5)
ofRepeatedItem_5 = List.OfRepeatedItem(item=watch_30, amount=code_block_23)
create_6 = List.Create(ofRepeatedItem_5)
watch_31 = Watch(create_6)
containsAnyItemOfList = Custom[ContainsAnyItemOfList](list=watch_29@L2, list_2=watch_31@L2)  # Result true if list contains any item of another list
watch_32 = Watch(containsAnyItemOfList)
filterByBoolMask_2 = List.FilterByBoolMask(list=watch_29@L2, mask=watch_32@L2)
watch_33 = Watch(filterByBoolMask_2.out)

sheets = Sheets("zBS-001 : Unnamed")
schedules_2 = Custom[Sheet.Schedules](sheet=sheets)
getDataColumns = Revit.Schedule.GetDataColumns(schedules_2@L2)  # unwired: arg1
watch_34 = Watch(getDataColumns)
getData = Revit.Schedule.GetData(schedules_2)
boolean_4 = BoolSelector(true)
getData_2 = Revit.Schedule.GetData(schedules_2, boolean_4)
containsAnyItemOfList_2 = Custom[ContainsAnyItemOfList](list=getData@L2, list_2=getData_2@L2)
filterByBoolMask_3 = List.FilterByBoolMask(list=watch_34@L2, mask=containsAnyItemOfList_2@L2)
watch_35 = Watch(filterByBoolMask_3.out)
watch_36 = Watch(containsAnyItemOfList_2)
watch_37 = Watch(filterByBoolMask_3.in)
watch_38 = Watch(getData_2)

# group: Schedule Impot
schedule = Watch(watch_4)

getDataRows = Revit.Schedule.GetDataRows(schedules_2)  # unwired: arg1
watch_39 = Watch(getDataRows)
watch_40 = Watch(getData_2)
file_path = Filename("..\Desktop\export.xls")
code_block_25 = CodeBlock { "test"; }
code_block_26 = CodeBlock { 0; }
writeToFile = Excel.WriteToFile(filePath=file_path, sheetName=code_block_25, overWrite=code_block_26)  # unwired: startRow, startCol, data
code_block_27 = CodeBlock { {0,1}; }
code_block_28 = CodeBlock { {0,0}; }
watch_41 = Watch(getData)

# group: schedule data
code_block_29 = CodeBlock(a=watch_41) { a[0]; }

# group: select the headers (create a list of empty values so that you can write the headers in excel in a row)
code_block_30 = CodeBlock { ""; }
code_block_31 = CodeBlock(a=code_block_29) { a[0]; }
count_2 = List.Count(code_block_31)
ofRepeatedItem_6 = List.OfRepeatedItem(item=code_block_30, amount=count_2)
code_block_32 = CodeBlock(a=code_block_29, b=ofRepeatedItem_6) { {a[0],b}; }

transpose = List.Transpose(code_block_29)

# group: select the data that you want to export
code_block_33 = CodeBlock(a=transpose) { a[0..2]; }

# group: remove the headers
restOfItems = List.RestOfItems(code_block_33, lacing=Longest)

# group: combine the 2 lists
code_block_34 = CodeBlock(a=code_block_32, b=restOfItems) { {a,b}; }

# group: magic
combine = List.Combine(writeToFile, code_block_27, code_block_28, code_block_34)
