# Dynamo graph Facegeometry.dyn (Dynamo 2.1.0.6255)

select_model_elements = DSModelElementsSelection()  # 1 picked in the model
python_script = Python(IN[0]=select_model_elements)
# ---------- python_script.python (75 lines) ----------
import clr

clr.AddReference('ProtoGeometry')
from Autodesk.DesignScript.Geometry import *

clr.AddReference('RevitAPI')
from Autodesk.Revit.DB import *
from Autodesk.Revit.DB.Structure import *

clr.AddReference('RevitAPIUI')
from Autodesk.Revit.UI import *

clr.AddReference('System')
from System.Collections.Generic import List

clr.AddReference('RevitNodes')
import Revit
clr.ImportExtensions(Revit.GeometryConversion)
clr.ImportExtensions(Revit.Elements)

clr.AddReference('RevitServices')
import RevitServices
from RevitServices.Persistence import DocumentManager
from RevitServices.Transactions import TransactionManager

doc = DocumentManager.Instance.CurrentDBDocument
uidoc=DocumentManager.Instance.CurrentUIApplication.ActiveUIDocument

#Preparing input from dynamo to revit
beam = UnwrapElement(IN[0])

geomOptions = Options()
geomOptions.ComputeReferences = True
geomOptions.View = doc.ActiveView

geo = beam.get_Geometry( geomOptions )

faceNormals = [];
yVectors = []
origins = []
zero = Vector.ByCoordinates(0,0,0)
xVectors = []
areas = []

xyz = []

ty = beam.GetTransform().BasisY.ToVector()

for obj in geo:
	if isinstance(obj, Solid):
		for geomFace in obj.Faces:
			faceNormal = geomFace.FaceNormal.ToVector()
			yVector = geomFace.YVector.ToVector()
			xVector = geomFace.XVector
			if faceNormal == ty:
				areas.append(geomFace.Area)
				faceNormals.append(faceNormal)
				yVectors.append(yVector)
				xVectors.append(xVector.ToVector())
				xyz.append(xVector)
				origins.append(geomFace.Origin.ToPoint())
			#areas.append(geomFace.Area)

ho = beam.HandOrientation.ToVector()
			
#Do some action in a Transaction
TransactionManager.Instance.EnsureInTransaction(doc)

TransactionManager.Instance.TransactionTaskDone()

maxi = max(areas)

index = areas.IndexOf(maxi)

OUT = faceNormals[index], yVectors[index], origins[index], xVectors[index],ho, ty
# ----------------------------------------
code_block = CodeBlock(a=python_script) { a[2]; a[0]; }
code_block_2 = CodeBlock { 1000; }
byStartPointDirectionLength = Line.ByStartPointDirectionLength(startPoint=code_block.out0, direction=code_block.out1, length=code_block_2)
byCurve = ModelCurve.ByCurve(curve=byStartPointDirectionLength)
code_block_3 = CodeBlock(a=python_script) { a[1]; }
byStartPointDirectionLength_2 = Line.ByStartPointDirectionLength(startPoint=code_block.out0, direction=code_block_3, length=code_block_2)
byCurve_2 = ModelCurve.ByCurve(curve=byStartPointDirectionLength_2)
python_script_2 = Python(IN[0]=select_model_elements)  # frozen
# ---------- python_script_2.python (66 lines) ----------
import clr

clr.AddReference('ProtoGeometry')
from Autodesk.DesignScript.Geometry import *

clr.AddReference('RevitAPI')
from Autodesk.Revit.DB import *
from Autodesk.Revit.DB.Structure import *

clr.AddReference('RevitAPIUI')
from Autodesk.Revit.UI import *

clr.AddReference('System')
from System.Collections.Generic import List

clr.AddReference('RevitNodes')
import Revit
clr.ImportExtensions(Revit.GeometryConversion)
clr.ImportExtensions(Revit.Elements)

clr.AddReference('RevitServices')
import RevitServices
from RevitServices.Persistence import DocumentManager
from RevitServices.Transactions import TransactionManager

doc = DocumentManager.Instance.CurrentDBDocument
uidoc=DocumentManager.Instance.CurrentUIApplication.ActiveUIDocument

#Preparing input from dynamo to revit
beam = UnwrapElement(IN[0])

geomOptions = Options()
geomOptions.ComputeReferences = True
geomOptions.View = doc.ActiveView

geo = beam.get_Geometry( geomOptions )

faceNormals = [];
yVectors = []
origins = []
zero = Vector.ByCoordinates(0,0,0)
xVectors = []
areas = []


for obj in geo:
	if isinstance(obj, Solid):
		for geomFace in obj.Faces:
			faceNormal = geomFace.FaceNormal.ToVector()
			yVector = geomFace.YVector.ToVector()
			xVector = geomFace.XVector.ToVector()
			faceNormals.append(faceNormal)
			yVectors.append(yVector)
			xVectors.append(xVector)
			origins.append(geomFace.Origin.ToPoint())
			if xVector.Cross(yVector) == faceNormal:
				areas.append(geomFace.Area)
			
#Do some action in a Transaction
TransactionManager.Instance.EnsureInTransaction(doc)

TransactionManager.Instance.TransactionTaskDone()

index = 4

OUT = faceNormals[index], yVectors[index], origins[index], xVectors[index], areas
# ----------------------------------------
code_block_4 = CodeBlock(t1=python_script) { t2 = List.MaximumItem(t1); }
code_block_5 = CodeBlock(a=python_script) { a[3]; }
code_block_6 = CodeBlock { 2000; }
byStartPointDirectionLength_3 = Line.ByStartPointDirectionLength(startPoint=code_block.out0, direction=code_block_5, length=code_block_6)
byCurve_3 = ModelCurve.ByCurve(curve=byStartPointDirectionLength_3)
red = Custom[Color.Red]()  # Returns the colour red.
overrideColorInView = Element.OverrideColorInView(element=byCurve_3, color=red)
clean = List.Clean()  # unwired: list
isNull = Object.IsNull()  # unwired: obj
isNull_2 = Object.IsNull()  # unwired: obj
