# Dynamo graph FamilyPlaceHostBeam.DYN "FamilyPlaceHostBeam.DYN" (Dynamo 2.0.1.5055)

# group: Families to populate
family_types = FamilyTypes()  # nothing selected; graph input
family_types_2 = FamilyTypes()  # nothing selected; graph input

# group: Get Elements in Plan View
all_elements_in_active_view = ElementsInView()  # graph input

# group: Group them
groupByCategory = Custom[Element.GroupByCategory](elements=all_elements_in_active_view)  # Group elements by categories

code_block = CodeBlock(x=groupByCategory.Groups) { x; }
string_from_object = FromObject(obj=groupByCategory.Keys)

# group: Isolate Lines
code_block_2 = CodeBlock { "Lines"; }
firstIndexOf = List.FirstIndexOf(list=string_from_object, item=code_block_2)
getItemAtIndex = List.GetItemAtIndex(list=code_block, index=firstIndexOf)

code_block_3 = CodeBlock { "Line Style"; }
getParameterValueByName = Element.GetParameterValueByName(element=getItemAtIndex, parameterName=code_block_3)

# group: Only Peno Lines!
code_block_4 = CodeBlock(e=getParameterValueByName) { e.Name; }
code_block_5 = CodeBlock { "Peno"; }

contains = String.Contains(str=code_block_4, searchFor=code_block_5)

# group (continued): Only Peno Lines!
filterByBoolMask = List.FilterByBoolMask(list=getItemAtIndex, mask=contains)
filterByBoolMask_2 = List.FilterByBoolMask(list=code_block_4, mask=contains)

# group: Separate Round from Square
code_block_6 = CodeBlock { "Dia"; }
contains_2 = String.Contains(str=filterByBoolMask_2.in, searchFor=code_block_6)
filterByBoolMask_3 = List.FilterByBoolMask(list=filterByBoolMask.in, mask=contains_2)
create = List.Create(item0=filterByBoolMask_3.in, item1=filterByBoolMask_3.out)
code_block_7 = CodeBlock { 1; }
flatten = List.Flatten(list=create, amt=code_block_7)
filterByBoolMask_4 = List.FilterByBoolMask(list=filterByBoolMask_2.in, mask=contains_2)

# group: Isolate Framing Elements
code_block_8 = CodeBlock { "Structural Framing"; }
firstIndexOf_2 = List.FirstIndexOf(list=string_from_object, item=code_block_8)
getItemAtIndex_2 = List.GetItemAtIndex(list=groupByCategory.Groups, index=firstIndexOf_2)

code_block_9 = CodeBlock(x=getItemAtIndex_2) { x; }

# group: Intersect element lines and detail lines
curve = DetailCurve.Curve(detailCurve=flatten)
getLocation = Element.GetLocation(element=code_block_9)
intersect = Geometry.Intersect(geometry=curve, other=getLocation, lacing=CrossProduct)
doesIntersect = Geometry.DoesIntersect(geometry=curve, other=getLocation, lacing=CrossProduct)

# group: Intersection Points... these are on the top of the beam so we need to shift them down by half the depth
clean = Orchid.Generic.Core.List.Clean(list=intersect)

# group: Intersection points between lines and structural members
flatten_2 = List.Flatten()  # unwired: list
map = List.Map(list=clean, f_x=flatten_2)

# group: Circ
code_block_10 = CodeBlock { "- "; "Dia"; }
split = String.Split(str=filterByBoolMask_4.in, separater0=code_block_10.out0, separater1=code_block_10.out1)

# group: Circ Depth
code_block_11 = CodeBlock { 1; }
getItemAtIndex_3 = List.GetItemAtIndex(list=split@L2, index=code_block_11)

# group: This tells us how many Circ items there are... we need to chop this number of items from the front of the set width parameter list
code_block_12 = CodeBlock { 0; 1; }
count = List.Count(list=getItemAtIndex_3)
slice = List.Slice(list=map, start=code_block_12.out0, end=count, step=code_block_12.out1)
count_2 = List.Count(list=slice)

circ_count = CodeBlock(x=count_2) { x; }
circ_count_2 = CodeBlock(x=circ_count) { x; }
code_block_13 = CodeBlock(x=code_block_9) { x; }
code_block_14 = CodeBlock { true; }
indexOf = Custom[RIE.IndexOf](List=doesIntersect@L2, Item=code_block_14)  # Returns a sublistlist with all indexes for each item.
code_block_15 = CodeBlock { 1; }
flatten_3 = List.Flatten(list=indexOf, amt=code_block_15)

# group: Structural members which intersect line
getItemAtIndex_4 = List.GetItemAtIndex(list=code_block_13, index=flatten_3)

# group: Generate the correct number of rectangular and circular in order
code_block_16 = CodeBlock(y=circ_count_2) { y; }
cycle = List.Cycle(list=family_types, amount=code_block_16)
code_block_17 = CodeBlock(x=family_types_2) { x; }
flatten_4 = List.Flatten(list=getItemAtIndex_4)
code_block_18 = CodeBlock(x=flatten_4) { x; }
count_3 = List.Count(list=code_block_18)
code_block_19 = CodeBlock(x=count_3, y=code_block_16) { x - y; }
cycle_2 = List.Cycle(list=code_block_17, amount=code_block_19)
create_2 = List.Create(item0=cycle, item1=cycle_2)
code_block_20 = CodeBlock { 1; }
flatten_5 = List.Flatten(list=create_2, amt=code_block_20)

# group: Sort beam faces and get 1 of the largest ones
faces = Element.Faces(element=getItemAtIndex_4)
area = Surface.Area(surface=faces)
sortByKey = List.SortByKey(list=faces@L2, keys=area@L2)
code_block_21 = CodeBlock(x=sortByKey.sorted_list) { x; }
lastItem = List.LastItem(list=code_block_21@L2)

flatten_6 = List.Flatten(list=clean)

# group: Location line for beam is at top, so we need to shift the intersect points down by half the beam height, then back up by half the height of the family
elementType = Element.ElementType(element=getItemAtIndex_4)
code_block_22 = CodeBlock { "Height"; }
getParameterValueByName_2 = Element.GetParameterValueByName(element=elementType@L2, parameterName=code_block_22)
# note: Make it negative to move down
code_block_23 = CodeBlock(x=getParameterValueByName_2) { x*-1; }
# note: Convert from cms to mm
code_block_24 = CodeBlock(x=code_block_23) { x*10; }
# note: move down half the height
# note: having dificulty getting instance parameter default value, doesn't seem to exist in the type with conventional methods
code_block_25 = CodeBlock(x=code_block_24) { x/2; }
flatten_7 = List.Flatten(list=code_block_25)
code_block_26 = CodeBlock { 300; }
# note: move back up half the family height (P_Depth)
code_block_27 = CodeBlock(x=flatten_7, Depth=code_block_26) { x - (Depth/2); }
translate = Geometry.Translate(geometry=flatten_6, zTranslation=code_block_27)

# group: Direction along beam is required for placement
getLocation_2 = Element.GetLocation(element=getItemAtIndex_4)
code_block_28 = CodeBlock(x=getLocation_2) { x; }
direction = Line.Direction(line=code_block_28)
flatten_8 = List.Flatten(list=direction)

# group: Create Families
byFace = FamilyInstance.ByFace(familyType=flatten_5, face=lastItem, location=translate, referenceDirection=flatten_8)

# group: Rec
code_block_29 = CodeBlock { "- "; "x"; }
split_2 = String.Split(str=filterByBoolMask_4.out, separater0=code_block_29.out0, separater1=code_block_29.out1)

# group: Rec Width
code_block_30 = CodeBlock { 1; }
getItemAtIndex_5 = List.GetItemAtIndex(list=split_2@L2, index=code_block_30)
create_3 = List.Create(item0=getItemAtIndex_3, item1=getItemAtIndex_5)
code_block_31 = CodeBlock { 1; }
flatten_9 = List.Flatten(list=create_3, amt=code_block_31)
code_block_32 = CodeBlock { 1; }
chop = List.Chop(list=flatten_9, lengths=code_block_32)

count_4 = List.Count(list=map@L2)

# group: Rec Depth
code_block_33 = CodeBlock { 2; }
getItemAtIndex_6 = List.GetItemAtIndex(list=split_2@L2, index=code_block_33)
chop_2 = List.Chop(list=getItemAtIndex_6, lengths=code_block_32)

# group: Sizes per lines
cycle_3 = List.Cycle(list=chop@L2, amount=count_4)
cycle_4 = List.Cycle(list=chop_2@L2, amount=count_4)

flatten_10 = List.Flatten(list=cycle_3)
toNumber = String.ToNumber(str=flatten_10)
depth = CodeBlock(x=toNumber) { x; }
depth_2 = CodeBlock(x=depth) { x; }
flatten_11 = List.Flatten(list=cycle_4)
toNumber_2 = String.ToNumber(str=flatten_11)
width = CodeBlock(x=toNumber_2) { x; }
width_2 = CodeBlock(x=width) { x; }

# group: Set Sizes
code_block_34 = CodeBlock { "P_Void Depth"; }
depth_3 = CodeBlock(x=depth_2) { x; }
setParameterByName = Element.SetParameterByName(element=byFace, parameterName=code_block_34, value=depth_3)
circ_count_3 = CodeBlock(x=circ_count_2) { x; }
code_block_35 = CodeBlock { -1; 1; }
slice_2 = List.Slice(list=setParameterByName, start=circ_count_3, end=code_block_35.out0, step=code_block_35.out1)
code_block_36 = CodeBlock { "P_Void Depth"; }
width_3 = CodeBlock(x=width_2) { x; }
setParameterByName_2 = Element.SetParameterByName(element=slice_2, parameterName=code_block_36, value=width_3)

code_block_37 = CodeBlock { -200; }
