# Dynamo graph FamilyPlaceHostBeam01.DYN "FamilyPlaceHostBeam01.DYN" (Dynamo 2.0.1.5055)

code_block = CodeBlock { "Line Style"; }

# group: Direction along beam is required for placement
code_block_2 = CodeBlock { x; }  # unwired: x
direction = Line.Direction(line=code_block_2)
flatten = List.Flatten(list=direction)

# group: Group them
groupByCategory = Custom[Element.GroupByCategory]()  # Group elements by categories; unwired: elements

code_block_3 = CodeBlock(x=groupByCategory.Groups) { x; }
string_from_object = FromObject(obj=groupByCategory.Keys)

# group: Isolate Lines
code_block_4 = CodeBlock { "Lines"; }
firstIndexOf = List.FirstIndexOf(list=string_from_object, item=code_block_4)
getItemAtIndex = List.GetItemAtIndex(list=code_block_3, index=firstIndexOf)

# group: Only Peno Lines!
code_block_5 = CodeBlock { e.Name; }  # unwired: e
code_block_6 = CodeBlock { "Peno"; }

contains = String.Contains(str=code_block_5, searchFor=code_block_6)

# group (continued): Only Peno Lines!
filterByBoolMask = List.FilterByBoolMask(list=getItemAtIndex, mask=contains)
filterByBoolMask_2 = List.FilterByBoolMask(list=code_block_5, mask=contains)

# group: Separate Round from Square
code_block_7 = CodeBlock { "Dia"; }
contains_2 = String.Contains(str=filterByBoolMask_2.in, searchFor=code_block_7)
filterByBoolMask_3 = List.FilterByBoolMask(list=filterByBoolMask.in, mask=contains_2)
create = List.Create(item0=filterByBoolMask_3.in, item1=filterByBoolMask_3.out)
code_block_8 = CodeBlock { 1; }
flatten_2 = List.Flatten(list=create, amt=code_block_8)
filterByBoolMask_4 = List.FilterByBoolMask(list=filterByBoolMask_2.in, mask=contains_2)

# group: Rec
code_block_9 = CodeBlock { "- "; "x"; }
split = String.Split(str=filterByBoolMask_4.out, separater0=code_block_9.out0, separater1=code_block_9.out1)

# group: Intersect element lines and detail lines
intersect = Geometry.Intersect(lacing=CrossProduct)  # unwired: geometry, other
doesIntersect = Geometry.DoesIntersect(lacing=CrossProduct)  # unwired: geometry, other

# group: Intersection Points... these are on the top of the beam so we need to shift them down by half the depth
clean = Orchid.Generic.Core.List.Clean(list=intersect)

# group: Intersection points between lines and structural members
flatten_3 = List.Flatten()  # unwired: list
map = List.Map(list=clean, f_x=flatten_3)

count = List.Count(list=map@L2)

# group: Circ
code_block_10 = CodeBlock { "- "; "Dia"; }
split_2 = String.Split(str=filterByBoolMask_4.in, separater0=code_block_10.out0, separater1=code_block_10.out1)

# group: Circ Depth
code_block_11 = CodeBlock { 1; }
getItemAtIndex_2 = List.GetItemAtIndex(list=split_2@L2, index=code_block_11)

# group: Rec Width
code_block_12 = CodeBlock { 1; }
code_block_13 = CodeBlock { 1; }
getItemAtIndex_3 = List.GetItemAtIndex(list=split@L2, index=code_block_13)
create_2 = List.Create(item0=getItemAtIndex_2, item1=getItemAtIndex_3)
code_block_14 = CodeBlock { 1; }
flatten_4 = List.Flatten(list=create_2, amt=code_block_14)
chop = List.Chop(list=flatten_4, lengths=code_block_12)

# group: Rec Depth
code_block_15 = CodeBlock { 2; }
getItemAtIndex_4 = List.GetItemAtIndex(list=split@L2, index=code_block_15)
chop_2 = List.Chop(list=getItemAtIndex_4, lengths=code_block_12)

# group: Sizes per lines
cycle = List.Cycle(list=chop_2@L2, amount=count)
cycle_2 = List.Cycle(list=chop@L2, amount=count)

flatten_5 = List.Flatten(list=cycle)
toNumber = String.ToNumber(str=flatten_5)
width = CodeBlock(x=toNumber) { x; }
width_2 = CodeBlock(x=width) { x; }
flatten_6 = List.Flatten(list=cycle_2)
toNumber_2 = String.ToNumber(str=flatten_6)
depth = CodeBlock(x=toNumber_2) { x; }
depth_2 = CodeBlock(x=depth) { x; }

# group: This tells us how many Circ items there are... we need to chop this number of items from the front of the set width parameter list
code_block_16 = CodeBlock { 0; 1; }
count_2 = List.Count(list=getItemAtIndex_2)
slice = List.Slice(list=map, start=code_block_16.out0, end=count_2, step=code_block_16.out1)
count_3 = List.Count(list=slice)

circ_count = CodeBlock(x=count_3) { x; }
circ_count_2 = CodeBlock(x=circ_count) { x; }

# group: Set Sizes
code_block_17 = CodeBlock { "P_Void Depth"; }
width_3 = CodeBlock(x=width_2) { x; }
depth_3 = CodeBlock(x=depth_2) { x; }
circ_count_3 = CodeBlock(x=circ_count_2) { x; }
code_block_18 = CodeBlock { -1; 1; }
slice_2 = List.Slice(start=circ_count_3, end=code_block_18.out0, step=code_block_18.out1)  # unwired: list
code_block_19 = CodeBlock { "P_Void Depth"; }

code_block_20 = CodeBlock { -200; }
flatten_7 = List.Flatten(list=clean)

# group: Location line for beam is at top, so we need to shift the intersect points down by half the beam height, then back up by half the height of the family
code_block_21 = CodeBlock { "Height"; }
# note: Make it negative to move down
code_block_22 = CodeBlock { x*-1; }  # unwired: x
# note: Convert from cms to mm
code_block_23 = CodeBlock(x=code_block_22) { x*10; }
# note: move down half the height
# note: having dificulty getting instance parameter default value, doesn't seem to exist in the type with conventional methods
code_block_24 = CodeBlock(x=code_block_23) { x/2; }
flatten_8 = List.Flatten(list=code_block_24)
code_block_25 = CodeBlock { 300; }
# note: move back up half the family height (P_Depth)
code_block_26 = CodeBlock(x=flatten_8, Depth=code_block_25) { x - (Depth/2); }
translate = Geometry.Translate(geometry=flatten_7, zTranslation=code_block_26)

# group: Sort beam faces and get 1 of the largest ones
area = Surface.Area()  # unwired: surface
sortByKey = List.SortByKey(keys=area@L2)  # unwired: list
code_block_27 = CodeBlock(x=sortByKey.sorted_list) { x; }
lastItem = List.LastItem(list=code_block_27@L2)

# group: Isolate Framing Elements
code_block_28 = CodeBlock { "Structural Framing"; }
firstIndexOf_2 = List.FirstIndexOf(list=string_from_object, item=code_block_28)
getItemAtIndex_5 = List.GetItemAtIndex(list=groupByCategory.Groups, index=firstIndexOf_2)

code_block_29 = CodeBlock(x=getItemAtIndex_5) { x; }
code_block_30 = CodeBlock(x=code_block_29) { x; }
code_block_31 = CodeBlock { true; }
indexOf = Custom[RIE.IndexOf](List=doesIntersect@L2, Item=code_block_31)  # Returns a sublistlist with all indexes for each item.
code_block_32 = CodeBlock { 1; }
flatten_9 = List.Flatten(list=indexOf, amt=code_block_32)

# group: Structural members which intersect line
getItemAtIndex_6 = List.GetItemAtIndex(list=code_block_30, index=flatten_9)

# group: Generate the correct number of rectangular and circular in order
code_block_33 = CodeBlock(y=circ_count_2) { y; }
cycle_3 = List.Cycle(amount=code_block_33)  # unwired: list
code_block_34 = CodeBlock { x; }  # unwired: x
flatten_10 = List.Flatten(list=getItemAtIndex_6)
code_block_35 = CodeBlock(x=flatten_10) { x; }
count_4 = List.Count(list=code_block_35)
code_block_36 = CodeBlock(x=count_4, y=code_block_33) { x - y; }
cycle_4 = List.Cycle(list=code_block_34, amount=code_block_36)
create_3 = List.Create(item0=cycle_3, item1=cycle_4)
code_block_37 = CodeBlock { 1; }
flatten_11 = List.Flatten(list=create_3, amt=code_block_37)
