# Dynamo graph GIS EXMAPLE infrabimgis.dyn (Dynamo 1.3.1.1736)

file_path = Filename("..\Downloads\camposampiero_quote\camposampiero_quote.shp")
file_path_2 = Filename("..\Downloads\camposampiero_quote\camposampiero_quote.shp")
code_block = CodeBlock(a=file_path, b=file_path_2) { {a,b}; }
loadFromFile = EGIS.DynamoLib.Shape.LoadFromFile(file_path_2)
getFieldNames = EGIS.DynamoLib.Shape.GetFieldNames(loadFromFile)
code_block_2 = CodeBlock { 3; }
getRecordsAtField = EGIS.DynamoLib.Shape.GetRecordsAtField(loadFromFile, code_block_2)
toNumber = String.ToNumber(getRecordsAtField)
minimumItem = List.MinimumItem(toNumber)
watch = Watch(minimumItem)
byGeometry = DirectShape.ByGeometry()  # unwired: geometry, category
getAllShapesInAllRecords = EGIS.DynamoLib.Shape.GetAllShapesInAllRecords(loadFromFile)
code_block_3 = CodeBlock { 0; }
getItemAtIndex = List.GetItemAtIndex(list=getAllShapesInAllRecords, index=code_block_3, lacing=Longest)
code_block_4 = CodeBlock { Vector.ZAxis(); }
code_block_5 = CodeBlock(a=toNumber) { a==null; }
if_ = If(test=code_block_5, true=minimumItem, false=toNumber)
translate = Geometry.Translate(geometry=getItemAtIndex, direction=code_block_4, distance=if_)
code_block_6 = CodeBlock { 4; }
getRecordsAtField_2 = EGIS.DynamoLib.Shape.GetRecordsAtField(loadFromFile, code_block_6)
toNumber_2 = String.ToNumber(getRecordsAtField_2)
code_block_7 = CodeBlock(a=toNumber_2) { a==null; }
if_2 = If(test=code_block_7, true=minimumItem, false=toNumber_2)
code_block_8 = CodeBlock(b=if_, a=if_2) { (b-a); }
extrudeAsSolid = Curve.ExtrudeAsSolid(translate, code_block_8)
byGeometries = ImportInstance.ByGeometries(extrudeAsSolid)
