# Dynamo graph GISExample.dyn (Dynamo 2.0.0.3911)

file_path = Filename("046122e\CURVE.shp")
file_path_2 = Filename("046122e\FABBRIC.shp")
code_block = CodeBlock(a=file_path, b=file_path_2) { {a,b}; }
loadFromFile = EGIS.DynamoLib.Shape.LoadFromFile(file_path_2)
getFieldNames = EGIS.DynamoLib.Shape.GetFieldNames(loadFromFile)
getAllShapesInAllRecords = EGIS.DynamoLib.Shape.GetAllShapesInAllRecords(loadFromFile)
code_block_2 = CodeBlock { 0; }
getItemAtIndex = List.GetItemAtIndex(list=getAllShapesInAllRecords, index=code_block_2, lacing=Longest)
code_block_3 = CodeBlock { Vector.ZAxis(); }
code_block_4 = CodeBlock { 13; }
getRecordsAtField = EGIS.DynamoLib.Shape.GetRecordsAtField(loadFromFile, code_block_4)
toNumber = String.ToNumber(getRecordsAtField)
code_block_5 = CodeBlock(a=toNumber) { a==null; }
minimumItem = List.MinimumItem(toNumber)
if_ = If(test=code_block_5, true=minimumItem, false=toNumber)
translate = Geometry.Translate(geometry=getItemAtIndex, direction=code_block_3, distance=if_)
code_block_6 = CodeBlock { 14; }
getRecordsAtField_2 = EGIS.DynamoLib.Shape.GetRecordsAtField(loadFromFile, code_block_6)
toNumber_2 = String.ToNumber(getRecordsAtField_2)
code_block_7 = CodeBlock(a=toNumber_2) { a==null; }
if_2 = If(test=code_block_7, true=minimumItem, false=toNumber_2)
code_block_8 = CodeBlock(b=if_, a=if_2) { (b-a)*10+0.01; }
extrudeAsSolid = Curve.ExtrudeAsSolid(translate, code_block_8)
watch = Watch(minimumItem)
