# Dynamo graph GRID FROM CAD ALIGNMENT-06.dyn (Dynamo 2.0.1.5055)

# group: Reverse curve direction
boolean = BoolSelector(false)

# group: select imported DWG
select_model_element = DSModelElementSelection()  # 1 picked in the model
geometry = Element.Geometry(element=select_model_element)

reverse = Curve.Reverse(curve=geometry)
if_ = If(test=boolean, true=reverse, false=geometry)
number = DoubleInput(0)
length = Curve.Length(curve=if_)

# group: Chainage length you want to create (place number in code block in middle)(round to whole number. i.e 2,3,5,10)
code_block = CodeBlock { 2500; }

code_block_2 = CodeBlock(length=length, chainLength=code_block) { length/chainLength; }
floor = Math.Floor(number=code_block_2)
code_block_3 = CodeBlock { 1; }
add = floor + code_block_3
sequence = Sequence(start=number, amount=add, step=code_block)
parameterAtSegmentLength = Curve.ParameterAtSegmentLength(curve=if_, segmentLength=sequence, lacing=Longest)
pointAtParameter = Curve.PointAtParameter(curve=if_, param=parameterAtSegmentLength)
code_block_4 = CodeBlock(pt=pointAtParameter) { Point.ByCoordinates(pt.X,pt.Y,0); }
horizontalFrameAtParameter = Curve.HorizontalFrameAtParameter(curve=if_, param=parameterAtSegmentLength)
XAxis = CoordinateSystem.XAxis(coordinateSystem=horizontalFrameAtParameter)
ZAxis = Vector.ZAxis()
code_block_5 = CodeBlock { 90; }
rotate = Vector.Rotate(vector=XAxis, axis=ZAxis, degrees=code_block_5)
code_block_6 = CodeBlock(v=rotate) { Vector.ByCoordinates(v.X,v.Y,0); }

# group: grid line length
code_block_7 = CodeBlock { 10000; }

byStartPointDirectionLength = Line.ByStartPointDirectionLength(startPoint=code_block_4, direction=code_block_6, length=code_block_7)
code_block_8 = CodeBlock(totallength=code_block_7) { -totallength/2; }
translate = Geometry.Translate(geometry=byStartPointDirectionLength, direction=rotate, distance=code_block_8)
byCurve = ModelCurve.ByCurve(curve=translate)  # frozen

# group: Create grid in Revit
byLine = Grid.ByLine(line=translate)

flatten = List.Flatten(list=byLine)
code_block_9 = CodeBlock { "Name"; }
string = StringInput("G")
getParameterValueByName = Element.GetParameterValueByName(element=flatten, parameterName=code_block_9)
add_2 = string + getParameterValueByName
setParameterByName = Element.SetParameterByName(element=flatten, parameterName=code_block_9, value=add_2)
number_2 = DoubleInput(0.001)
mul = sequence * number_2

# group: Grid start number
code_block_10 = CodeBlock { 10; }

add_3 = mul + code_block_10
code_block_11 = CodeBlock(n=add_3) { Math.Round(n,2)[0]; }
string_from_object_python = Python(IN[0]=code_block_11)
# ---------- string_from_object_python.python (3 lines) ----------
names = IN[0]

OUT = [str(n).rstrip('0').rstrip('.') for n in names]
# ----------------------------------------
code_block_12 = CodeBlock { "m"; }
add_4 = string_from_object_python + code_block_12
setParameterByName_2 = Element.SetParameterByName(element=setParameterByName, parameterName=code_block_9, value=add_4)

# group: works when the curve is planar
normalAtParameter = Curve.NormalAtParameter(curve=if_, param=parameterAtSegmentLength)

XY = Plane.XY()
byPoints = PolyCurve.ByPoints(points=code_block_4)
explode = Geometry.Explode(geometry=byPoints)
flatten_2 = List.Flatten(list=explode)

# group: Multi segment grid
element_types = ElementTypes(index=143)
all_elements_of_type = ElementsOfType(element_type=element_types)
XY_2 = Plane.XY()

code_block_13 = CodeBlock(a=all_elements_of_type) { a[0]; }
code_block_14 = CodeBlock { 560000; }
translate_2 = Geometry.Translate(geometry=XY_2, zTranslation=code_block_14)

# group (continued): Multi segment grid
byPlane = SketchPlane.ByPlane(plane=translate_2)
python_script = Python(IN[0]=code_block_13, IN[1]=explode, IN[2]=byPlane)
# ---------- python_script.python (58 lines) ----------
# Copyright(c) 2018, Konrad K Sobon
# @arch_laboratory, http://archi-lab.net

import clr
clr.AddReference('ProtoGeometry')
import Autodesk.DesignScript.Geometry

clr.AddReference("RevitNodes")
import Revit
clr.ImportExtensions(Revit.Elements)
clr.ImportExtensions(Revit.GeometryConversion)

clr.AddReference("RevitServices")
import RevitServices
from RevitServices.Persistence import DocumentManager
from RevitServices.Transactions import TransactionManager
doc = DocumentManager.Instance.CurrentDBDocument
uiapp = DocumentManager.Instance.CurrentUIApplication
app = uiapp.Application

clr.AddReference("RevitAPI")
from Autodesk.Revit.DB import *

import System
from System import Array
from System.Collections.Generic import *

import sys
pyt_path = r'C:\Program Files (x86)\IronPython 2.7\Lib'
sys.path.append(pyt_path)

def create_grid(type, curves, plane):
	typeId = UnwrapElement(type).Id
	plane = Plane.CreateByNormalAndOrigin(XYZ(0,0,1), XYZ(0,0,0))
	sketchPlane = SketchPlane.Create(doc, plane)
	curveLoop = CurveLoop()
	for i in curves:
		c = i.ToRevitType()
		curveLoop.Append(c)
	grid = MultiSegmentGrid.Create(doc, typeId, curveLoop, sketchPlane.Id)
	return grid

try:
    errorReport = None
    TransactionManager.Instance.EnsureInTransaction(doc)
    output = []
    for i in IN[1]:
    	output.append(create_grid(IN[0], i, IN[2]))
    TransactionManager.Instance.TransactionTaskDone()

except:
    import traceback
    errorReport = traceback.format_exc()

if None == errorReport:
    OUT = output
else:
    OUT = errorReport
# ----------------------------------------
