# Dynamo graph GetBeamWidth.dyn (Dynamo 2.0.1.5055)

select_model_element = DSModelElementSelection()  # 1 picked in the model
python_script = Python(IN[0]=select_model_element)
# ---------- python_script.python (46 lines) ----------
import clr

clr.AddReference('RevitAPI')
from Autodesk.Revit.DB import *
from Autodesk.Revit.DB.Structure import *

clr.AddReference('RevitAPIUI')
from Autodesk.Revit.UI import *

clr.AddReference('System')
from System.Collections.Generic import List

clr.AddReference('RevitNodes')
import Revit
clr.ImportExtensions(Revit.GeometryConversion)
clr.ImportExtensions(Revit.Elements)

clr.AddReference('RevitServices')
import RevitServices
from RevitServices.Persistence import DocumentManager
from RevitServices.Transactions import TransactionManager

doc = DocumentManager.Instance.CurrentDBDocument
uidoc=DocumentManager.Instance.CurrentUIApplication.ActiveUIDocument

element = UnwrapElement(IN[0])

instTransform = None;


def GetBeamWidth(element):
	opt = Options()
	opt.ComputeReferences = True
	opt.IncludeNonVisibleObjects = False
	opt.View = doc.ActiveView
	
	for instance in element.get_Geometry(opt):
		try:
			geomInst = instance.GetSymbolGeometry()
			instTransform = instance.Transform;
			width = (geomInst.GetBoundingBox().Max.Y - geomInst.GetBoundingBox().Min.Y)*304.8
		except:
			continue
	return width

OUT = GetBeamWidth(element)
# ----------------------------------------
code_block = CodeBlock(a=select_model_element) { [a]; }
