# Dynamo graph Grid Bubble End.dyn (Dynamo 1.3.2.2480)

# note: Grid End 1
code_block = CodeBlock { "1"; }
# note: Grid End 0
code_block_2 = CodeBlock { "0"; }
# note: Swap Bubble Grid Ends
python_script = Python(IN[1]=code_block_2)  # unwired: IN[0]
# ---------- python_script.python (47 lines) ----------
#Put view on sheet
import clr
clr.AddReference('RevitAPI')
from Autodesk.Revit.DB import *

clr.AddReference("RevitNodes")
import Revit
clr.ImportExtensions(Revit.Elements)

clr.AddReference("RevitServices")
import RevitServices
from RevitServices.Persistence import DocumentManager
from RevitServices.Transactions import TransactionManager

import clr
clr.AddReference('ProtoGeometry')

from Autodesk.DesignScript.Geometry import *

doc = DocumentManager.Instance.CurrentDBDocument
#The inputs to this node will be stored as a list in the IN variables.
grids = UnwrapElement(IN[0])

a = UnwrapElement(IN[1])

if a == "0":
	b = DatumEnds.End0
else:
	b = DatumEnds.End1

	# "Start" the transaction
TransactionManager.Instance.EnsureInTransaction(doc)

view = doc.ActiveView	

for grid in grids:
	
	grid.HideBubbleInView(DatumEnds.End0, view);
	grid.HideBubbleInView(DatumEnds.End1, view);
	grid.ShowBubbleInView(b, view);

# "End" the transaction
TransactionManager.Instance.TransactionTaskDone()


#Assign your output to the OUT variable.
OUT = 0
# ----------------------------------------
end_0 = Python()  # unwired: IN[0]
# ---------- end_0.python (45 lines) ----------
#Put view on sheet
import clr
clr.AddReference('RevitAPI')
from Autodesk.Revit.DB import *

clr.AddReference("RevitNodes")
import Revit
clr.ImportExtensions(Revit.Elements)

clr.AddReference("RevitServices")
import RevitServices
from RevitServices.Persistence import DocumentManager
from RevitServices.Transactions import TransactionManager

import clr
clr.AddReference('ProtoGeometry')

from Autodesk.DesignScript.Geometry import *

doc = DocumentManager.Instance.CurrentDBDocument
#The inputs to this node will be stored as a list in the IN variables.
grids = UnwrapElement(IN[0])

b = DatumEnds.End0
c = DatumEnds.End1

	# "Start" the transaction
TransactionManager.Instance.EnsureInTransaction(doc)

view = doc.ActiveView	

for grid in grids:
	
	grid.HideBubbleInView(DatumEnds.End0, view);
	grid.HideBubbleInView(DatumEnds.End1, view);
	grid.ShowBubbleInView(b, view);
	grid.Pinned = False
	grid.Pinned = True

# "End" the transaction
TransactionManager.Instance.TransactionTaskDone()


#Assign your output to the OUT variable.
OUT = 0
# ----------------------------------------
# note: Select Grids
select_model_elements = DSModelElementsSelection()  # 2 picked in the model
select_model_elements_2 = DSModelElementsSelection()  # 3 picked in the model
code_block_3 = CodeBlock(A=select_model_elements, B=select_model_elements_2) { Flatten({A,B}); }
end_1 = Python(IN[0]=code_block_3)
# ---------- end_1.python (46 lines) ----------
#Put view on sheet
import clr
clr.AddReference('RevitAPI')
from Autodesk.Revit.DB import *

clr.AddReference("RevitNodes")
import Revit
clr.ImportExtensions(Revit.Elements)

clr.AddReference("RevitServices")
import RevitServices
from RevitServices.Persistence import DocumentManager
from RevitServices.Transactions import TransactionManager

import clr
clr.AddReference('ProtoGeometry')

from Autodesk.DesignScript.Geometry import *

doc = DocumentManager.Instance.CurrentDBDocument
#The inputs to this node will be stored as a list in the IN variables.
grids = UnwrapElement(IN[0])



b = DatumEnds.End0
c = DatumEnds.End1

	# "Start" the transaction
TransactionManager.Instance.EnsureInTransaction(doc)

view = doc.ActiveView	

for grid in grids:
	
	grid.HideBubbleInView(DatumEnds.End0, view);
	grid.HideBubbleInView(DatumEnds.End1, view);
	grid.ShowBubbleInView(c, view);
	grid.Pinned = False
	grid.Pinned = True
# "End" the transaction
TransactionManager.Instance.TransactionTaskDone()


#Assign your output to the OUT variable.
OUT = 0
# ----------------------------------------
setPinnedStatus = Custom[Element.SetPinnedStatus]()  # Will set the element to either pinned or not pinned. True is pinned, false is unpinned. For multiple elements use List.Map; unwired: element
