# Dynamo graph Home.dyn (Dynamo 1.3.3.4651)

# group: Crown Height at Corner
integer_slider = IntegerSlider(11, range=5..15 step 1)

# group: Center of the Crown (Column Height)
number_slider = DoubleSlider(0.8, range=0.3..1 step 0.1)
sub = integer_slider - number_slider
code_block = CodeBlock(ColumnHeight=sub) { Point.ByCoordinates(0,0,ColumnHeight); }

# group: Half Crown Width
integer_slider_2 = IntegerSlider(6, range=5..15 step 1)

# group: Crown Height at Midspan
number_slider_2 = DoubleSlider(1, range=0.3..1.5 step 0.1)

byCorner = Custom[Rectangle.ByCorner](HalfCrownWidth=integer_slider_2, HeightAtCorner=integer_slider, HeightAtMidPoint=number_slider_2)
byStartPointEndPoint = Line.ByStartPointEndPoint(startPoint=code_block, endPoint=byCorner.CornerPoints)
code_block_2 = CodeBlock { 0.5; }
pointAtParameter = Curve.PointAtParameter(curve=byStartPointEndPoint, param=code_block_2)

# group: Rib arc rise
number_slider_3 = DoubleSlider(0.6, range=0..1 step 0.1)

translate = Geometry.Translate(geometry=pointAtParameter, zTranslation=number_slider_3)

# group: Rib arc
byThreePoints = Arc.ByThreePoints(firstPoint=code_block, secondPoint=translate, thirdPoint=byCorner.CornerPoints)

# group: Primary Beam to Rib Point
number_slider_4 = DoubleSlider(0.1, range=0..1 step 0.1)

pointAtParameter_2 = Curve.PointAtParameter(curve=byThreePoints, param=number_slider_4)

# group: Diagonals (Primary beams)
byStartPointEndPoint_2 = Line.ByStartPointEndPoint(startPoint=pointAtParameter_2, endPoint=byCorner.ArcMiddlePoints)

splitByPoints = Curve.SplitByPoints(curve=byThreePoints, points=pointAtParameter_2)
deconstruct = List.Deconstruct(list=splitByPoints)

# group: Number of Secondary beams
integer_slider_3 = IntegerSlider(7, range=5..15 step 1)

code_block_3 = CodeBlock(SecBeams=integer_slider_3) { 1/SecBeams..1-1/SecBeams..#SecBeams; }
pointAtParameter_3 = Curve.PointAtParameter(curve=deconstruct.rest, param=code_block_3, lacing=Longest)

# group: Crown Edge Arcs
YAxis = Vector.YAxis()
XAxis = Vector.XAxis()
create = List.Create(YAxis, XAxis)
byStartPointEndPointStartTangent = Arc.ByStartPointEndPointStartTangent(byCorner.ArcMiddlePoints, byCorner.CornerPoints, create)

pointAtParameter_4 = Curve.PointAtParameter(curve=byStartPointEndPointStartTangent, param=code_block_3, lacing=CrossProduct)

# group: Secondary Beams
byStartPointEndPoint_3 = Line.ByStartPointEndPoint(startPoint=pointAtParameter_3, endPoint=pointAtParameter_4@L2)

create_2 = List.Create(byThreePoints, byStartPointEndPoint_2, byStartPointEndPoint_3, byStartPointEndPointStartTangent)
flatten = Flatten(create_2)
origin = Point.Origin()
ZAxis = Vector.ZAxis()
code_block_4 = CodeBlock { 90..270..#3; }
rotate = Geometry.Rotate(geometry=flatten, origin=origin, axis=ZAxis, degrees=code_block_4@L2, lacing=Longest)

# group: Columns
origin_2 = Point.Origin()
ZAxis_2 = Vector.ZAxis()
byStartPointEndPointStartTangent_2 = Arc.ByStartPointEndPointStartTangent(origin_2, byCorner.ArcMiddlePoints, ZAxis_2)

# group: Trunk fork position
number_slider_5 = DoubleSlider(0.6, range=0..1 step 0.1)

pointAtParameter_5 = Curve.PointAtParameter(curve=byStartPointEndPointStartTangent_2, param=number_slider_5)

# group: Forks
byStartPointEndPoint_4 = Line.ByStartPointEndPoint(startPoint=pointAtParameter_5, endPoint=code_block)

create_3 = List.Create(byStartPointEndPointStartTangent_2, byStartPointEndPoint_4)
origin_3 = Point.Origin()
byThreePoints_2 = Plane.ByThreePoints(code_block, origin_3, byCorner.CornerPoints)
ZAxis_3 = Vector.ZAxis()
code_block_5 = CodeBlock { 90; }
rotate_2 = Geometry.Rotate(geometry=byThreePoints_2, origin=origin_3, axis=ZAxis_3, degrees=code_block_5)
mirror = Geometry.Mirror(geometry=create_3, mirrorPlane=rotate_2)
