# Dynamo graph HydraTest.dyn (Dynamo 1.3.1.1736)

code_block = CodeBlock { "Hydra Example"; "This is an example"; "v1.3"; "Example file to test Dynamo 1.3"; "sample,wiki"; }
string = StringInput("C:\Users\giovanni.brogiolo\Documents\GitHub\hydra")
hydra = HydraShare(code_block.out0, code_block.out1, code_block.out2, code_block.out3, code_block.out4, string)
