# Dynamo graph IFCRhynamo.dyn (Dynamo 1.3.1.1736)

code_block = CodeBlock { 0; }
file_path = Filename("C:\Users\giovanni.brogiolo\Desktop\dynamoToRhyno.3dm")
code_block_2 = CodeBlock { true; }
code_block_3 = CodeBlock { 10000..35000..#100; }
byCoordinates = Point.ByCoordinates(x=code_block_3, y=code_block_3, lacing=CrossProduct)
code_block_4 = CodeBlock { 50; }
byLengths = Cuboid.ByLengths(origin=byCoordinates, width=code_block_4, length=code_block_4, height=code_block_4, lacing=Longest)
bySolid = PolySurface.BySolid(byLengths)
DS_BrepToRhino = Interoperability.WriteRhino.CreateRhinoGeometry.DS_BrepToRhino(bySolid)
string_from_object = FromObject(code_block_3)
code_block_5 = CodeBlock(a=string_from_object) { "Cube"+a; }
code_block_6 = CodeBlock(a=code_block_3, b=code_block_3) { (a/35000)*Math.Random(100,200); (a/35000)*Math.Random(10,300); (b/35000)*Math.Random(10,200); }
create_RhinoColor = Interoperability.WriteRhino.CreateRhinoObjects.Create_RhinoColor(code_block_6.out0, code_block_6.out1, code_block_6.out2)
code_block_7 = CodeBlock { "From Dynamo"; }
code_block_8 = CodeBlock(a=create_RhinoColor) { a[0]; }
create_RhinoLayer = Interoperability.WriteRhino.CreateRhinoObjects.Create_RhinoLayer(code_block_7, code_block_8)
create_RhinoObject = Interoperability.WriteRhino.CreateRhinoObjects.Create_RhinoObject(DS_BrepToRhino, code_block_5, create_RhinoColor, create_RhinoLayer, lacing=Longest)
code_block_9 = CodeBlock { "meters"; }
save_Rhino3dmModel = Interoperability.WriteRhino.SaveRhino3dmModel.Save_Rhino3dmModel(file_path, code_block_2, create_RhinoObject@L3, code_block_9, lacing=Longest)
byARGB = Color.ByARGB(r=code_block_6.out0, g=code_block_6.out1, b=code_block_6.out2)
byGeometryColor = Display.Display.ByGeometryColor(byLengths, byARGB, lacing=Longest)
