# Dynamo graph LanguageBall.dyn (Dynamo 1.3.1.1736)

byWidthLength = Rectangle.ByWidthLength()
explode = Geometry.Explode(byWidthLength)
startPoint = Curve.StartPoint(explode)
code_block = CodeBlock { 2; }
permutations = List.Permutations(startPoint, code_block)
code_block_2 = CodeBlock()
# ---------- code_block_2.designscript (1 lines) ----------
{0.713144,0.044254,0.857919,0.240211,0.827313,0.896566,0.277374,0.444549,0.720047,0.646851,0.063777,0.940377,0.978143,0.384778,0.156861,0.203861,0.122342,0.199084,0.016859,0.554971,
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
# ----------------------------------------
code_block_3 = CodeBlock { 7; }
cycle = List.Cycle(list=code_block_2, amount=code_block_3)
code_block_4 = CodeBlock { 0; 11; }
remapRange = Math.RemapRange(numbers=cycle, newMin=code_block_4.out0, newMax=code_block_4.out1)
code_block_5 = CodeBlock { 3; }
chop = List.Chop(list=remapRange, lengths=code_block_5)
getItemAtIndex = List.GetItemAtIndex(list=permutations, index=chop)
byBestFitThroughPoints = Line.ByBestFitThroughPoints(getItemAtIndex)
code_block_6 = CodeBlock { 0..100..2; }
translate = Geometry.Translate(xTranslation=code_block_6)  # unwired: geometry
code_block_7 = CodeBlock { 100; }
byWidthLength_2 = Rectangle.ByWidthLength(width=code_block_7, length=code_block_7)
byPatch = Surface.ByPatch(byWidthLength_2)
byOrigin = CoordinateSystem.ByOrigin()
code_block_8 = CodeBlock { 40; }
byCenterPointRadius = Sphere.ByCenterPointRadius(radius=code_block_8)
explode_2 = Geometry.Explode(byCenterPointRadius)
code_block_9 = CodeBlock(n=code_block_8) { -n..n..1.5; }
byCoordinates = Point.ByCoordinates(x=code_block_9, y=code_block_9, lacing=CrossProduct)
flatten = Flatten(byCoordinates)
ZAxis = Vector.ZAxis()
reverse = Vector.Reverse(ZAxis)
projectInputOnto = Surface.ProjectInputOnto(explode_2@L1, flatten, reverse)
flatten_2 = Flatten(projectInputOnto)
code_block_10 = CodeBlock(x=explode_2) { x[0]; }
normalAtPoint = Surface.NormalAtPoint(surface=code_block_10, point=flatten_2)
byOriginNormal = Plane.ByOriginNormal(origin=flatten_2, normal=normalAtPoint)
byPlane = CoordinateSystem.ByPlane(byOriginNormal)
transform = Geometry.Transform(geometry=getItemAtIndex, fromCoordinateSystem=byOrigin, contextCoordinateSystem=byPlane)
code_block_11 = CodeBlock { 100; }
byCoordinates_2 = Point.ByCoordinates(z=code_block_11)
byTwoPoints = Vector.ByTwoPoints(start=byCoordinates_2, end=transform)
projectInputOnto_2 = Surface.ProjectInputOnto(byPatch, transform, byTwoPoints)
flatten_3 = Flatten(projectInputOnto_2@L3)
byBestFitThroughPoints_2 = Line.ByBestFitThroughPoints(flatten_3)
file_path = Filename(".\LanguageBall_fillet.dxf")
code_block_12 = CodeBlock { 3; }
chop_2 = List.Chop(list=flatten_3, lengths=code_block_12)
flatten_4 = Flatten(chop_2@L3)
pruneDuplicates = Point.PruneDuplicates(points=flatten_4)
byPoints = PolyCurve.ByPoints(points=pruneDuplicates)
code_block_13 = CodeBlock { 0.2; false; }
fillet = PolyCurve.Fillet(byPoints, code_block_13.out0, code_block_13.out1)
code_block_14 = CodeBlock { false; }
clean = List.Clean(list=fillet, preserveIndices=code_block_14)
fromGeometries = Dynamo.Translation.FileWriter.FromGeometries(file_path, clean)  # frozen
byPoints_2 = NurbsCurve.ByPoints(flatten_4)
code_block_15 = CodeBlock { true; }
