# Dynamo graph Lesson1.dyn (Dynamo 1.3.2.2480)

code_block = CodeBlock { "Export from Revit"; }
code_block_2 = CodeBlock { 0; }
code_block_3 = CodeBlock { "Sheet Number"; }
code_block_4 = CodeBlock { "Sheet Name"; }
code_block_5 = CodeBlock { "Sheet Issue Date"; }
create = List.Create(code_block_3, code_block_4, code_block_5)
categories = Categories("TitleBlocks")
all_elements_of_category = ElementsOfCategory(categories)
getParameterValueByName = Element.GetParameterValueByName(element=all_elements_of_category, lacing=CrossProduct)  # unwired: parameterName
addItemToFront = List.AddItemToFront(item=create, list=getParameterValueByName)
code_block_6 = CodeBlock { 1; }
writeToFile = Excel.WriteToFile(sheetName=code_block, startRow=code_block_2, startCol=code_block_2, data=addItemToFront, overWrite=code_block_6)  # unwired: filePath
transpose = List.Transpose(addItemToFront)
file_path = Filename("..\Desktop\yesy.xls")
fromPath = FileObject(file_path)  # "File.FromPath"
code_block_7 = CodeBlock { 1; }
readFromFile = Excel.ReadFromFile(file=fromPath, sheetName=code_block, readAsStrings=code_block_7)
transpose_2 = List.Transpose(readFromFile)
code_block_8 = CodeBlock(a=transpose_2) { a[3]; }
code_block_9 = CodeBlock(a=transpose_2) { a[4]; }
create_2 = List.Create(code_block_8, code_block_9)
deconstruct = List.Deconstruct(list=create_2, lacing=Longest)
code_block_10 = CodeBlock(a=deconstruct.first) { a; }
setParameterByName = Element.SetParameterByName(element=all_elements_of_category@L2, parameterName=code_block_10, lacing=Longest)  # frozen; unwired: value
code_block_11 = CodeBlock(b=deconstruct.rest) { b; }
transpose_3 = List.Transpose(code_block_11)
setParameterByName_2 = Element.SetParameterByName(element=all_elements_of_category, parameterName=code_block_10@L2, lacing=Longest)  # frozen; unwired: value
code_block_12 = CodeBlock { {{1,2},{3,4}}; }
code_block_13 = CodeBlock { {5,6}; }
byCoordinates = Point.ByCoordinates(x=code_block_12, y=code_block_13)
python_script = Python(IN[0]=code_block_12, IN[1]=code_block_13)
# ---------- python_script.python (19 lines) ----------
import clr
clr.AddReference('ProtoGeometry')
from Autodesk.DesignScript.Geometry import *
#The inputs to this node will be stored as a list in the IN variables.
xs1 = IN[0]
ys1 = IN[1]

replication = []

cartesian = []

for x,y in zip(xs1,ys1):
	replication.append([x,y])
	for item in x:
		cartesian.append([item, y])


#Assign your output to the OUT variable.
OUT = cartesian
# ----------------------------------------
code_block_14 = CodeBlock()
# ---------- code_block_14.designscript (13 lines) ----------
/*

# Zip Replication on Level 1 for <1L> of xs, <1L> of ys, <1L> of zs
for x, y, z in xs, ys, zs
    # Zip Replication on level 2 for <2> of xs, <2> of zs
    for each ix, iz in x, z
        # Cartesian Replication on level 2 for <3> of ys
        for each iy in y
            # Cartesian Replication on level 3 for <2> of zs
            for each iiz in iz
                foo(ix, iy, iiz);

*/;
# ----------------------------------------
code_block_15 = CodeBlock { {{1,2},{3,4}}; }
code_block_16 = CodeBlock { {{5,6},{7,8}}; }
byCoordinates_2 = Point.ByCoordinates(x=code_block_15, y=code_block_16)
python_script_2 = Python(IN[0]=code_block_15, IN[1]=code_block_16)
# ---------- python_script_2.python (21 lines) ----------
import clr
clr.AddReference('ProtoGeometry')
from Autodesk.DesignScript.Geometry import *
#The inputs to this node will be stored as a list in the IN variables.
xs1 = IN[0]
ys1 = IN[1]

replication = []

cartesian = []

for x,y in zip(xs1,ys1):
	replication.append([x,y])
	subList = []
	cartesian.append(subList)
	for itemX, itemY in zip(x,y):
		subList.append([itemX, itemY])


#Assign your output to the OUT variable.
OUT = cartesian
# ----------------------------------------
code_block_17 = CodeBlock { {{1,2},{3,4}}; }
code_block_18 = CodeBlock { {{5,6},{7,8}}; }
byCoordinates_3 = Point.ByCoordinates(x=code_block_17@L1, y=code_block_18)
python_script_3 = Python(IN[0]=code_block_17, IN[1]=code_block_18)
# ---------- python_script_3.python (21 lines) ----------
import clr
clr.AddReference('ProtoGeometry')
from Autodesk.DesignScript.Geometry import *
#The inputs to this node will be stored as a list in the IN variables.
xs = IN[0]
ys = IN[1]

replication = []

cartesian = []

for i in range(0,len(xs)):
	subList = []
	cartesian.append(subList)
	for j in range(0,len(xs[i])):
		for y in ys:
			subList.append([xs[i][j],y])


#Assign your output to the OUT variable.
OUT = cartesian
# ----------------------------------------
python_script_4 = Python(IN[0]=code_block_17, IN[1]=code_block_18)
# ---------- python_script_4.python (24 lines) ----------
import clr
clr.AddReference('ProtoGeometry')
from Autodesk.DesignScript.Geometry import *
#The inputs to this node will be stored as a list in the IN variables.
xs = IN[0]
ys = IN[1]

replication = []

cartesian = []

for item in xs:
	subList = []
	cartesian.append(subList)
	for x in item:
		subSub = []
		subList.append(subSub)
		for item in ys:
			for y in item:
				subSub.append([str(x)+"&"+str(y)])


#Assign your output to the OUT variable.
OUT = cartesian
# ----------------------------------------
python_script_5 = Python(IN[0]=code_block_17, IN[1]=code_block_18)
# ---------- python_script_5.python (22 lines) ----------
import clr
clr.AddReference('ProtoGeometry')
from Autodesk.DesignScript.Geometry import *
#The inputs to this node will be stored as a list in the IN variables.
xs = IN[0]
ys = IN[1]

replication = []

cartesian = []

for itemX, itemY in xs,ys:
	subList = []
	cartesian.append(subList)
	for x,y in itemX,itemY:
		subSub = []
		subList.append(subSub)
		subSub.append([str(x)+"&"+str(y)])


#Assign your output to the OUT variable.
OUT = cartesian
# ----------------------------------------
code_block_19 = CodeBlock { 5; }
code_block_20 = CodeBlock { 8; }
create_3 = List.Create(code_block_19, code_block_20)
code_block_21 = CodeBlock { 1..10; }
add = create_3 + code_block_21
string = StringInput("FromRevit")
number = DoubleInput(0)
string_2 = StringInput("Sheet Number")
string_3 = StringInput("Sheet Name")
string_4 = StringInput("Drawn By")
create_4 = List.Create(string_2, string_3, string_4)
categories_2 = Categories("TitleBlocks")
all_elements_of_category_2 = ElementsOfCategory(categories_2)
getParameterValueByName_2 = Element.GetParameterValueByName(element=all_elements_of_category_2, parameterName=create_4, lacing=CrossProduct)
addItemToFront_2 = List.AddItemToFront(item=create_4, list=getParameterValueByName_2)
boolean = BoolSelector(false)
writeToFile_2 = Excel.WriteToFile(sheetName=string, startRow=number, startCol=number, data=addItemToFront_2, overWrite=boolean)  # unwired: filePath
dropItems = List.DropItems()  # unwired: list, amount
categories_3 = Categories("TitleBlocks")
all_elements_of_category_3 = ElementsOfCategory(categories_3)

# group: Read from Excel
file_path_2 = Filename("..\Desktop\titleblockFromRevit.xls")
fromPath_2 = FileObject(file_path_2)  # "File.FromPath"
string_5 = StringInput("FromRevit")
boolean_2 = BoolSelector(true)
readFromFile_2 = Excel.ReadFromFile(file=fromPath_2, sheetName=string_5, readAsStrings=boolean_2)

number_2 = DoubleInput(2)
getItemAtIndex = List.GetItemAtIndex(list=readFromFile_2, index=number_2, lacing=Longest)
deconstruct_2 = List.Deconstruct(list=getItemAtIndex)
setParameterByName_3 = Element.SetParameterByName(element=all_elements_of_category_3, parameterName=deconstruct_2.first, value=deconstruct_2.rest)
