# Dynamo graph Lesson2.dyn (Dynamo 1.3.2.2480)

all_elements_in_active_view = ElementsInView()
name = FamilyType.Name()  # unwired: arg0
groupByFunction = GroupByFunction(all_elements_in_active_view, name)
code_block = CodeBlock(a=groupByFunction) { a[0..3]; }
count = List.Count(code_block)
code_block_2 = CodeBlock(count=count) { 0..1..#count; }
color_range = ColorRange(arg2=code_block_2)  # unwired: arg0, arg1
overrideColorInView = Element.OverrideColorInView(element=code_block, color=color_range)
red = Custom[Color.Red]()  # Returns the colour red.
green = Custom[Color.Green]()  # Returns the colour green.
blue = Custom[Color.Blue]()  # Returns the colour blue.
purple = Custom[Color.Purple]()  # Returns the colour purple.
join = List.Join(red, green, blue, purple)
code_block_3 = CodeBlock { {0,1}; }
join_2 = List.Join(red, blue)
