# Dynamo graph Loft03.dyn (Dynamo 1.3.3.4651)

select_model_element = DSModelElementSelection()  # 1 picked in the model
curves = Element.Curves(select_model_element)
byJoinedCurves = PolyCurve.ByJoinedCurves(curves)
length = Curve.Length(curves, lacing=Longest)
number = DoubleInput(0.5)
byPlaneRadius = Circle.ByPlaneRadius(radius=number)
controlPoints = NurbsCurve.ControlPoints(curves)
number_2 = DoubleInput(0)
planeAtParameter = Curve.PlaneAtParameter(curve=controlPoints, param=number_2)
bySweep = Solid.BySweep()  # unwired: arg0, arg1
splitByPoints = Curve.SplitByPoints(curve=curves, points=controlPoints)
number_3 = DoubleInput(0.5)
buildPipes = TSpline.TSplineSurface.BuildPipes(curves, number_3)
toBRep = TSpline.TSplineSurface.ToBRep()  # unwired: arg0
