# Dynamo graph Parser.dyn (Dynamo 2.0.0.3911)

file_path = Filename("C:\Users\giovanni.brogiolo\Downloads\DataMiner.csv")
fromPath = FileObject(file_path)  # "File.FromPath"
code_block = CodeBlock { "Sheet1"; }
code_block_2 = CodeBlock { 0; }
readFromFile = Excel.ReadFromFile(file=fromPath, sheetName=code_block, readAsStrings=code_block_2)
transpose = List.Transpose(readFromFile)
code_block_3 = CodeBlock(Products=transpose) { Products[1]; }
code_block_4 = CodeBlock(Title=transpose) { Title[0]; }
code_block_5 = CodeBlock { {"touch"}; }
code_block_6 = CodeBlock { 1; }
contains = String.Contains(str=code_block_4, searchFor=code_block_5, ignoreCase=code_block_6, lacing=Longest)
filterByBoolMask = List.FilterByBoolMask(list=code_block_4, mask=contains)
code_block_7 = CodeBlock(a=filterByBoolMask.in) { a; }
code_block_8 = CodeBlock(Votes=transpose) { Votes[2]; }
filterByBoolMask_2 = List.FilterByBoolMask(list=code_block_8, mask=contains)
