# Dynamo graph PickElements.dyn (Dynamo 2.0.1.5055)

code_block = CodeBlock { "Structural Connections"; }

# group: Press Run. To Run again, set refresh to True or False
refresh = BoolSelector(true)
python_script = Python(IN[0]=refresh, IN[1]=code_block)
# ---------- python_script.python (52 lines) ----------
import clr

clr.AddReference('RevitAPI')
from Autodesk.Revit.DB import *
from Autodesk.Revit.DB.Structure import *


clr.AddReference('RevitAPIUI')
from Autodesk.Revit.UI import *
from Autodesk.Revit.UI.Selection import *


clr.AddReference('System')
from System.Collections.Generic import List

clr.AddReference('RevitNodes')
import Revit
clr.ImportExtensions(Revit.GeometryConversion)
clr.ImportExtensions(Revit.Elements)

clr.AddReference('RevitServices')
import RevitServices
from RevitServices.Persistence import DocumentManager
from RevitServices.Transactions import TransactionManager

import math
from System.Collections.Generic import Dictionary,List

doc = DocumentManager.Instance.CurrentDBDocument
uidoc=DocumentManager.Instance.CurrentUIApplication.ActiveUIDocument


class CustomISelectionFilter(ISelectionFilter):
	def __init__(self, category_name):
		self.category_name = category_name
	def AllowElement(self, e):
		if e.Category.Name == self.category_name:
			return True
		else:
			return False
	def AllowReference(self, ref, point):
		return false
		

try:
    beam = uidoc.Selection.PickObjects(ObjectType.Element, CustomISelectionFilter(IN[1]), "Select something")
    TaskDialog.Show("Result", "You have selected " + str(len(beam)) + " beams")
except:
    TaskDialog.Show("Operation Cancelled","The user cancelled the operation")
    
    
OUT = [doc.GetElement(b) for b in beam]
# ----------------------------------------

code_block_2 = CodeBlock { [0..2]; }
removeItemAtIndex = List.RemoveItemAtIndex(list=python_script, indices=code_block_2)
code_block_3 = CodeBlock(a=removeItemAtIndex) { a[0]; }
code_block_4 = CodeBlock { "Beam Type"; }
code_block_5 = CodeBlock(ele=code_block_3, p=code_block_4) { Element.GetParameterValueByName(ele,p); }
code_block_6 = CodeBlock { "730x"; }
contains = String.Contains(str=code_block_5, searchFor=code_block_6)
filterByBoolMask = List.FilterByBoolMask(list=code_block_3, mask=contains)
code_block_7 = CodeBlock { Element.SetParameterByName(eles, p, value); }  # unwired: eles, p, value
