# Dynamo graph Print_PDF Current Model.dyn (Dynamo 1.3.1.1736)

file_path = Filename("C:\Users\giovanni.brogiolo\Documents\Project2_giovanni.brogiolo.rvt")
print_range = PrintRangeUi("Current")
boolean = BoolSelector(false)
local_printers_names = Custom[Local Printers Names]()  # This node will query all locally installed printers and return their names.
code_block = CodeBlock(a=local_printers_names) { a[1]; }
print_settings = PrintSettingUi("Default")
string = StringInput("C:\Users\giovanni.brogiolo\Documents\Project33.pdf")
boolean_2 = BoolSelector(true)
print_pdf = Custom[Print PDF](PrintRange=print_range, CombinedFile=boolean, PrinterName=code_block, PrintSettings=print_settings, FilePath=string, RunIt=boolean_2)  # This node will allow you to initiate a printing routine in revit from a set of views/sheets, printer name, print settings and print range.; unwired: Views
rename_files = Custom[Rename Files]()  # This node will use an "identifier" to pick out files from a supplied directory to rename files to a new name supplied. Please make sure to match list lengths of identifier and new name inputs.; unwired: DirectoryPath, Identifiers, NewNames, RunIt
string_2 = StringInput("C:\TEMP")
code_block_2 = CodeBlock { "20170829123"; }
categories = Categories("Sheets")
all_elements_of_category = ElementsOfCategory(categories)
sheetNumber = Sheet.SheetNumber(all_elements_of_category)
code_block_3 = CodeBlock()
# ---------- code_block_3.designscript (1 lines) ----------
{"055016","055021","055022","055023","055024","055025","055026","055027","055028","080401","310400","310404","310405","310407","310414","310415","310417","310453","310461","310500","310504","310505","310510","310551","320501","320401","320502","321000","330001","330004","330005","330401","330601","345000","345016","345021","345022","345023","345024","345025","345026","345027","345028","345041","345044","405701","405801","406301","430002"};
# ----------------------------------------
allIndicesOf = List.AllIndicesOf(list=sheetNumber, item=code_block_3)
flatten = Flatten(allIndicesOf)
getItemAtIndex = List.GetItemAtIndex(list=all_elements_of_category, index=flatten)
flatten_2 = Flatten(getItemAtIndex)
code_block_4 = CodeBlock(a=flatten_2) { a[1..3]; }
code_block_5 = CodeBlock { "Sheet Number"; }
getParameterValueByName = Element.GetParameterValueByName(element=code_block_4, parameterName=code_block_5)
code_block_6 = CodeBlock(a=getParameterValueByName) { "M-BAR-1F4TS0-CB00-EDR-"+a+".pdf"; }
boolean_3 = BoolSelector(true)
python_script = Python(IN[0]=string_2, IN[1]=code_block_2, IN[2]=code_block_6, IN[3]=boolean_3)
# ---------- python_script.python (56 lines) ----------
#Copyright(c) 2015, Konrad Sobon
# @arch_laboratory, http://archi-lab.net

import clr
clr.AddReference('ProtoGeometry')
from Autodesk.DesignScript.Geometry import *

# Import DocumentManager and TransactionManager
clr.AddReference("RevitServices")
import RevitServices
from RevitServices.Persistence import DocumentManager
from RevitServices.Transactions import TransactionManager

doc = DocumentManager.Instance.CurrentDBDocument
uiapp = DocumentManager.Instance.CurrentUIApplication
app = uiapp.Application

# Import RevitAPI
clr.AddReference("RevitAPI")
import Autodesk
from Autodesk.Revit.DB import *
from Autodesk.Revit import *
import System

import sys
pyt_path = r'C:\Program Files (x86)\IronPython 2.7\Lib'
sys.path.append(pyt_path)

import os
filePath = IN[0]
identifiers = IN[1]
newNames = IN[2]
RunIt = IN[3]

files = os.listdir(filePath)

if RunIt:
	message = "Success"
	for file in files:
		currentFileName = filePath + "\\" + file
		
		for i, j in zip(identifiers, newNames):
			newFileName = filePath + "\\" + j
	
			if i in file and currentFileName != newFileName:
				try:
					os.rename(currentFileName, newFileName)
				except:
					message = "Your intended file name is not a compatible file name. Make sure that you are not strings like..."
					pass
else:
	message = "Please set RunIt to True."

#docName = uiapp.ActiveUIDocument.Document.Title
#Assign your output to the OUT variable
OUT = message
# ----------------------------------------
