# Dynamo graph Python_Test.dyn (Dynamo 1.3.2.2480)

LV = DSModelElementSelection()
DB = DSModelElementSelection()  # 1 picked in the model
create = List.Create(DB)
DB_2 = DSModelElementSelection()  # 1 picked in the model
create_2 = List.Create(DB_2)
create_3 = List.Create(create, create_2)
create_4 = List.Create(LV, create_3)
watch = Watch(create_4)
LV_2 = DSModelElementSelection()  # 1 picked in the model
DB_3 = DSModelElementSelection()  # 1 picked in the model
create_5 = List.Create(DB_3)
DB_4 = DSModelElementSelection()  # 1 picked in the model
create_6 = List.Create(DB_4)
create_7 = List.Create(create_5, create_6)
create_8 = List.Create(LV_2, create_7)
watch_2 = Watch(create_8)
create_9 = List.Create(watch, watch_2)
watch_3 = Watch(create_9)
select_model_elements = DSModelElementsSelection()  # 3 picked in the model
select_model_elements_2 = DSModelElementsSelection()  # 3 picked in the model
code_block = CodeBlock(a=select_model_elements, b=select_model_elements_2) { {a,b}; }
watch_4 = Watch(code_block)
python_script = Python(IN[0]=watch_4)  # frozen
# ---------- python_script.python (61 lines) ----------
import clr
clr.AddReference('ProtoGeometry')
from Autodesk.DesignScript.Geometry import *

clr.AddReference('RevitServices')
import RevitServices
from RevitServices.Persistence import DocumentManager
from RevitServices.Transactions import TransactionManager
from System.Collections.Generic import *

clr.AddReference('RevitNodes')
import Revit
clr.ImportExtensions(Revit.Elements)

clr.AddReference('RevitAPI')
import Autodesk
from Autodesk.Revit.DB import *
from Autodesk.Revit.DB.Electrical import *
from Autodesk.Revit.DB import MEPSystem

clr.AddReference('DSCoreNodes')
import DSCore
from DSCore.List import *

import sys
pyt_path = r'C:\Program Files (x86)\IronPython 2.7\Lib'
sys.path.append(pyt_path)

# Import List ( ICollection(ElementId) = List[ElementId]() )
clr.AddReference("System")
from System.Collections.Generic import List 

#The inputs to this node will be stored as a list in the IN variables.
input = UnwrapElement(IN[0])

ElectComponents = []
NewCircuit = []

for sublist in input:
	sub = List[ElementId]()
	ElectComponents.append(sub)
	for item in sublist:
		sub.Add(item.Id)
		
doc = DocumentManager.Instance.CurrentDBDocument
uiapp = DocumentManager.Instance.CurrentUIApplication
app = uiapp.Application
uidoc = DocumentManager.Instance.CurrentUIApplication.ActiveUIDocument

ListNewCircuit = []

TransactionManager.Instance.EnsureInTransaction(doc)


for e in ElectComponents:
		NewCircuit = doc.Create.NewElectricalSystem(e, ElectricalSystemType.PowerCircuit)
		ListNewCircuit.append(NewCircuit)
	
TransactionManager.Instance.TransactionTaskDone()

OUT = ListNewCircuit
# ----------------------------------------
watch_5 = Watch(python_script)
flatten = Flatten(watch_5)
type = Object.Type(flatten)
watch_6 = Watch(type)
python_script_2 = Python()  # unwired: IN[0], IN[1]
# ---------- python_script_2.python (19 lines) ----------
import clr
clr.AddReference('ProtoGeometry')
from Autodesk.DesignScript.Geometry import *
#The inputs to this node will be stored as a list in the IN variables.
dataEnteringNode = IN

DB = IN[0]
LV = IN[1]

List = []

for i in range(0,len(LV)):
	sublist = []
	List.append(sublist)
	for j in range(0,len(DB[i])):
		sublist.append(LV[i])
		sublist.append(DB[i][j])
	
OUT = List 
# ----------------------------------------
python_script_3 = Python(IN[0]=watch_4)  # frozen
# ---------- python_script_3.python (61 lines) ----------
import clr
clr.AddReference('ProtoGeometry')
from Autodesk.DesignScript.Geometry import *

clr.AddReference('RevitServices')
import RevitServices
from RevitServices.Persistence import DocumentManager
from RevitServices.Transactions import TransactionManager
from System.Collections.Generic import *

clr.AddReference('RevitNodes')
import Revit
clr.ImportExtensions(Revit.Elements)

clr.AddReference('RevitAPI')
import Autodesk
from Autodesk.Revit.DB import *
from Autodesk.Revit.DB.Electrical import *
from Autodesk.Revit.DB import MEPSystem

clr.AddReference('DSCoreNodes')
import DSCore
from DSCore.List import *

import sys
pyt_path = r'C:\Program Files (x86)\IronPython 2.7\Lib'
sys.path.append(pyt_path)

# Import List ( ICollection(ElementId) = List[ElementId]() )
clr.AddReference("System")
from System.Collections.Generic import List 

#The inputs to this node will be stored as a list in the IN variables.
input = UnwrapElement(IN[0])

ElectComponents = []
NewCircuit = []

for sublist in input:
	sub = List[ElementId]()
	ElectComponents.append(sub)
	for item in sublist:
		sub.Add(item.Id)
		
doc = DocumentManager.Instance.CurrentDBDocument
uiapp = DocumentManager.Instance.CurrentUIApplication
app = uiapp.Application
uidoc = DocumentManager.Instance.CurrentUIApplication.ActiveUIDocument

ListNewCircuit = []

TransactionManager.Instance.EnsureInTransaction(doc)


#for e in ElectComponents:
#		NewCircuit = doc.Create.NewElectricalSystem(e, ElectricalSystemType.PowerCircuit)
#		ListNewCircuit.append(NewCircuit)
	
TransactionManager.Instance.TransactionTaskDone()

OUT = ElectComponents
# ----------------------------------------
watch_7 = Watch(python_script_3)
DB_5 = DSModelElementsSelection()  # 3 picked in the model
watch_8 = Watch(DB_5)
DB_6 = DSModelElementsSelection()  # 4 picked in the model
watch_9 = Watch(DB_6)
create_10 = List.Create(watch_8, watch_9)
watch_10 = Watch(create_10)
LV_3 = DSModelElementsSelection()  # 1 picked in the model
LV_4 = DSModelElementsSelection()  # 1 picked in the model
create_11 = List.Create(LV_3, LV_4)
watch_11 = Watch(create_11)
format_gio = Python(IN[0]=watch_10, IN[1]=watch_11)
# ---------- format_gio.python (21 lines) ----------
import clr
clr.AddReference('ProtoGeometry')
from Autodesk.DesignScript.Geometry import *
#The inputs to this node will be stored as a list in the IN variables.
dataEnteringNode = IN

DB = IN[0]
LV = IN[1]

FL = []

for i in range(0,len(LV)):
	sublist = []
	FL.append(sublist)
	for j in range(0,len(DB[i])):
		sublist.append(LV[i])
		sublist.append(DB[i][j])


		
OUT = FL
# ----------------------------------------
flatten_2 = Flatten(format_gio)
code_block_2 = CodeBlock { 2; }
chop = List.Chop(list=flatten_2, lengths=code_block_2)
code_block_3 = CodeBlock { 1; }
getItemAtIndex = List.GetItemAtIndex(list=chop@L2, index=code_block_3)
watch_12 = Watch(getItemAtIndex)
code_block_4 = CodeBlock { 1; }
chop_2 = List.Chop(list=watch_12, lengths=code_block_4)
creates_circuits = Python(IN[0]=chop_2)
# ---------- creates_circuits.python (61 lines) ----------
import clr
clr.AddReference('ProtoGeometry')
from Autodesk.DesignScript.Geometry import *

clr.AddReference('RevitServices')
import RevitServices
from RevitServices.Persistence import DocumentManager
from RevitServices.Transactions import TransactionManager
from System.Collections.Generic import *

clr.AddReference('RevitNodes')
import Revit
clr.ImportExtensions(Revit.Elements)

clr.AddReference('RevitAPI')
import Autodesk
from Autodesk.Revit.DB import *
from Autodesk.Revit.DB.Electrical import *
from Autodesk.Revit.DB import MEPSystem

clr.AddReference('DSCoreNodes')
import DSCore
from DSCore.List import *

import sys
pyt_path = r'C:\Program Files (x86)\IronPython 2.7\Lib'
sys.path.append(pyt_path)

# Import List ( ICollection(ElementId) = List[ElementId]() )
clr.AddReference("System")
from System.Collections.Generic import List 

#The inputs to this node will be stored as a list in the IN variables.
input = UnwrapElement(IN[0])

ElectComponents = []
NewCircuit = []

for sublist in input:
	sub = List[ElementId]()
	ElectComponents.append(sub)
	for item in sublist:
		sub.Add(item.Id)
		
doc = DocumentManager.Instance.CurrentDBDocument
uiapp = DocumentManager.Instance.CurrentUIApplication
app = uiapp.Application
uidoc = DocumentManager.Instance.CurrentUIApplication.ActiveUIDocument

ListNewCircuit = []

TransactionManager.Instance.EnsureInTransaction(doc)


for e in ElectComponents:
		NewCircuit = doc.Create.NewElectricalSystem(e,ElectricalSystemType.PowerCircuit)
		ListNewCircuit.append(NewCircuit)
	
TransactionManager.Instance.TransactionTaskDone()

OUT = ListNewCircuit
# ----------------------------------------
watch_13 = Watch(creates_circuits)
code_block_5 = CodeBlock { 0; }
getItemAtIndex_2 = List.GetItemAtIndex(list=chop@L2, index=code_block_5)
flatten_3 = Flatten(getItemAtIndex_2)
watch_14 = Watch(flatten_3)
select_panel_for_circuit = Python(IN[0]=creates_circuits, IN[1]=watch_14)
# ---------- select_panel_for_circuit.python (63 lines) ----------
import clr
clr.AddReference('ProtoGeometry')
from Autodesk.DesignScript.Geometry import *

clr.AddReference('RevitServices')
import RevitServices
from RevitServices.Persistence import DocumentManager
from RevitServices.Transactions import TransactionManager
from System.Collections.Generic import *

clr.AddReference('RevitNodes')
import Revit
clr.ImportExtensions(Revit.Elements)

clr.AddReference('RevitAPI')
import Autodesk
from Autodesk.Revit.DB import *
from Autodesk.Revit.DB.Electrical import *
from Autodesk.Revit.DB import MEPSystem

clr.AddReference('DSCoreNodes')
import DSCore
from DSCore.List import *

import sys
pyt_path = r'C:\Program Files (x86)\IronPython 2.7\Lib'
sys.path.append(pyt_path)

# Import List ( ICollection(ElementId) = List[ElementId]() )
clr.AddReference("System")
from System.Collections.Generic import List 


circuit = UnwrapElement(IN[0])
panel = UnwrapElement(IN[1])
CL = []
PL = []
test = []

doc = DocumentManager.Instance.CurrentDBDocument
uiapp = DocumentManager.Instance.CurrentUIApplication
app = uiapp.Application
uidoc = DocumentManager.Instance.CurrentUIApplication.ActiveUIDocument

TransactionManager.Instance.EnsureInTransaction(doc)

#for _ in circuit:
#	_.SelectPanel(panel)
#for i in range(0,len(circuit)):
	#CL.append(panel[i])
	#PL.append(circuit[i])
	#for j in CL:
		#j.SelectPanel(PL)
		
for i in range(0,len(circuit)):
	circuit[i].SelectPanel(panel[i])
	
TransactionManager.Instance.TransactionTaskDone()


#Assign your output to the OUT variable.
OUT = []
OUT = circuit
# ----------------------------------------
watch_15 = Watch(select_panel_for_circuit)
python_script_4 = Python()  # frozen; unwired: IN[0]; same code as python_script
watch_16 = Watch(chop)
watch_17 = Watch(chop_2)
