# Dynamo graph Section.dyn (Dynamo 1.3.2.2480)

boundingBox = Element.BoundingBox()  # unwired: arg0
views = Views("70 - Sh - G.A. Section")
python_script = Python(IN[0]=views)
# ---------- python_script.python (63 lines) ----------
# Copyright(c) 2016, Konrad K Sobon
# @arch_laboratory, http://archi-lab.net

# Import Element wrapper extension methods
import clr
clr.AddReference("RevitNodes")
import Revit
clr.ImportExtensions(Revit.Elements)

# Import DocumentManager and TransactionManager
clr.AddReference("RevitServices")
import RevitServices
from RevitServices.Persistence import DocumentManager
from RevitServices.Transactions import TransactionManager
doc = DocumentManager.Instance.CurrentDBDocument

# Import RevitAPI
clr.AddReference("RevitAPI")
import Autodesk
from Autodesk.Revit.DB import *

import sys
pyt_path = r'C:\Program Files (x86)\IronPython 2.7\Lib'
sys.path.append(pyt_path)

#The inputs to this node will be stored as a list in the IN variable.
dataEnteringNode = IN

def Unwrap(item):
	return UnwrapElement(item)

def ProcessList(_func, _list):
    return map( lambda x: ProcessList(_func, x) if type(x)==list else _func(x), _list )

def GetFamilyType(famInst):
	try:
		id = famInst.GetTypeId()
		if id == ElementId.InvalidElementId:
			return None
		else:
			return doc.GetElement(id)
	except:
		return None
		pass

if isinstance(IN[0], list):
	elements = ProcessList(Unwrap, IN[0])
else:
	elements = [Unwrap(IN[0])]

try:
	errorReport = None
	output = ProcessList(GetFamilyType, elements)
except:
	# if error accurs anywhere in the process catch it
	import traceback
	errorReport = traceback.format_exc()

#Assign your output to the OUT variable
if errorReport == None:
	OUT = output
else:
	OUT = errorReport
# ----------------------------------------
properties = Custom[BoundingBox.Properties](boundingBox=boundingBox)  # Retrieves the centroid, width, depth and height of a given bounding box
python_script_2 = Python(IN[0]=boundingBox, IN[1]=python_script, IN[2]=properties.Centroid)
# ---------- python_script_2.python (64 lines) ----------
import clr
clr.AddReference("ProtoGeometry")
from Autodesk.DesignScript.Geometry import *
# Import RevitAPI
clr.AddReference("RevitAPI")
from Autodesk.Revit.DB import *
clr.AddReference("RevitAPIUI")
from Autodesk.Revit.UI import TaskDialog
# Import DocumentManager and TransactionManager
clr.AddReference("RevitServices")
from RevitServices.Persistence import DocumentManager
from RevitServices.Transactions import TransactionManager
# Import ToProtoType, ToRevitType geometry conversion extension methods
clr.AddReference("RevitNodes")
import Revit
clr.ImportExtensions(Revit.GeometryConversion)

doc = DocumentManager.Instance.CurrentDBDocument
uiapp = DocumentManager.Instance.CurrentUIApplication
app = uiapp.Application


ebbox = UnwrapElement(IN[0])

viewFamily = UnwrapElement(IN[1])

convBoxMax = ebbox.MaxPoint.ToXyz()
convBoxMin = ebbox.MinPoint.ToXyz()

w = (convBoxMax.X - convBoxMin.X)
d = (convBoxMax.Y - convBoxMin.Y)
h = (convBoxMax.Z - convBoxMin.Z)

maxPt = XYZ(w, h, 0.0)
minPt = XYZ(-w, -h, -d)
  
bbox = BoundingBoxXYZ()

bbox.Enabled = True
bbox.Max = maxPt
bbox.Min = minPt

trans = Transform.Identity

midPt = UnwrapElement(IN[2]).ToXyz()

trans.Origin = midPt
 
 
trans.BasisX = XYZ.BasisX
trans.BasisY = XYZ.BasisZ
trans.BasisZ = -XYZ.BasisY
 
bbox.Transform = trans

TransactionManager.Instance.EnsureInTransaction(doc)

viewSection = ViewSection.CreateSection(doc, viewFamily[0].Id, bbox)


TransactionManager.Instance.TransactionTaskDone()


OUT = w,d,h, viewSection
# ----------------------------------------
select_model_element = DSModelElementSelection()
python_script_3 = Python(IN[0]=select_model_element, IN[1]=python_script)
# ---------- python_script_3.python (92 lines) ----------
import clr
clr.AddReference("ProtoGeometry")
from Autodesk.DesignScript.Geometry import *
# Import RevitAPI
clr.AddReference("RevitAPI")
from Autodesk.Revit.DB import *
clr.AddReference("RevitAPIUI")
from Autodesk.Revit.UI import TaskDialog
# Import DocumentManager and TransactionManager
clr.AddReference("RevitServices")
from RevitServices.Persistence import DocumentManager
from RevitServices.Transactions import TransactionManager
# Import ToProtoType, ToRevitType geometry conversion extension methods
clr.AddReference("RevitNodes")
import Revit
clr.ImportExtensions(Revit.GeometryConversion)

doc = DocumentManager.Instance.CurrentDBDocument
uiapp = DocumentManager.Instance.CurrentUIApplication
app = uiapp.Application


wall = UnwrapElement(IN[0])

vft = UnwrapElement(IN[1])

lc = wall.Location

line = lc.Curve

'start point'
p = line.GetEndPoint(0)

'end point'
q = line.GetEndPoint(1)

'wall length'
v = q - p

bb = wall.get_BoundingBox( None )

minZ = bb.Min.Z;
maxZ = bb.Max.Z;

'bb Width - x direction'
w = v.GetLength();

'bb Height'
h = maxZ - minZ;



'section extent in x direction'
offset = 0.1
"""
min = XYZ(-w, minZ - offset, -offset)
max = XYZ(w, maxZ + offset, 0)
(width in plan, height view in section, position in plan)

"""
min = XYZ(-w/2-2, -10, 0)
max = XYZ(w/2+2, 40, 0.1)


midpoint = p + 0.5 * v;

walldir = -v.Normalize(); #+- change view direction
up = XYZ.BasisZ;
viewdir = walldir.CrossProduct( up );
 
t = Transform.Identity;
t.Origin = XYZ(midpoint.X, midpoint.Y, 0) ;
t.BasisX = walldir;
t.BasisY = up;
t.BasisZ = viewdir;


sectionBox = BoundingBoxXYZ();
sectionBox.Transform = t;
sectionBox.Min = min;
sectionBox.Max = max;

	

TransactionManager.Instance.EnsureInTransaction(doc)

section=ViewSection.CreateSection( doc, vft[0].Id, sectionBox )

TransactionManager.Instance.TransactionTaskDone()


OUT = section, q,p
# ----------------------------------------
toCuboid = BoundingBox.ToCuboid(python_script_3)
byGeometry = ImportInstance.ByGeometry(toCuboid)
boundingBox_2 = Element.BoundingBox(select_model_element)

# group: Cross Section (X-Vector)
select_model_element_2 = DSModelElementSelection()  # 1 picked in the model
viewFamilyTypes = ViewFamilyTypes("70 - Sh - GA Section")
localCoordinateSystem = Custom[Element.LocalCoordinateSystem](element=select_model_element_2)  # Get the insertion point and local axes of an element.
code_block = CodeBlock { {-500,500}; }
translate = Geometry.Translate(geometry=localCoordinateSystem.InsertionPoint, direction=localCoordinateSystem.Xvector, distance=code_block, lacing=Longest)
python_script_4 = Python(IN[0]=select_model_element_2, IN[1]=viewFamilyTypes, IN[2]=localCoordinateSystem.InsertionPoint, IN[3]=translate)
# ---------- python_script_4.python (90 lines) ----------
import clr
clr.AddReference("ProtoGeometry")
from Autodesk.DesignScript.Geometry import *
# Import RevitAPI
clr.AddReference("RevitAPI")
from Autodesk.Revit.DB import *
clr.AddReference("RevitAPIUI")
from Autodesk.Revit.UI import TaskDialog
# Import DocumentManager and TransactionManager
clr.AddReference("RevitServices")
from RevitServices.Persistence import DocumentManager
from RevitServices.Transactions import TransactionManager
# Import ToProtoType, ToRevitType geometry conversion extension methods
clr.AddReference("RevitNodes")
import Revit
clr.ImportExtensions(Revit.GeometryConversion)

doc = DocumentManager.Instance.CurrentDBDocument
uiapp = DocumentManager.Instance.CurrentUIApplication
app = uiapp.Application


wall = UnwrapElement(IN[0])

vft = UnwrapElement(IN[1])

midpoint = UnwrapElement(IN[2])[0].ToXyz()




'start point'
p = UnwrapElement(IN[3])[0].ToXyz()
'end point'
q = UnwrapElement(IN[3])[1].ToXyz()

'wall length'
v = q - p

bb = wall.get_BoundingBox( None )

minZ = bb.Min.Z;
maxZ = bb.Max.Z;


'bb Height'
h = maxZ - minZ;



'section extent in x direction'
offset = 0.1
"""
min = XYZ(-w, minZ - offset, -offset)
max = XYZ(w, maxZ + offset, 0)
(width in plan, height view in section, position in plan)

"""
min = XYZ(-2, -10, 0)
max = XYZ(2, 40, 0.1)



walldir = -v.Normalize() #+- change view direction
up = XYZ.BasisZ;
viewdir = walldir.CrossProduct( up );
 
 
t = Transform.Identity;
t.Origin = XYZ(midpoint.X, midpoint.Y, 0) ;
t.BasisX = walldir;
t.BasisY = up;
t.BasisZ = viewdir


sectionBox = BoundingBoxXYZ();
sectionBox.Transform = t;
sectionBox.Min = min;
sectionBox.Max = max;

	

TransactionManager.Instance.EnsureInTransaction(doc)

section=ViewSection.CreateSection( doc, vft.Id, sectionBox )

TransactionManager.Instance.TransactionTaskDone()


OUT = section, midpoint
# ----------------------------------------

# group: Cross Section (Y-Vector)
select_model_element_3 = DSModelElementSelection()  # 1 picked in the model
viewFamilyTypes_2 = ViewFamilyTypes("70 - Sh - GA Section")
localCoordinateSystem_2 = Custom[Element.LocalCoordinateSystem](element=select_model_element_3)
code_block_2 = CodeBlock { {-500,500}; }
translate_2 = Geometry.Translate(geometry=localCoordinateSystem_2.InsertionPoint, direction=localCoordinateSystem_2.Yvector, distance=code_block_2, lacing=Longest)
python_script_5 = Python(IN[0]=select_model_element_3, IN[1]=viewFamilyTypes_2, IN[2]=localCoordinateSystem_2.InsertionPoint, IN[3]=translate_2)  # same code as python_script_4
