# Dynamo graph SetElementOjectId.dyn (Dynamo 0.8.2.2392)

python_script = Python()
# ---------- python_script.python (59 lines) ----------
import clr
# Import RevitAPI
clr.AddReference("RevitAPI")
from Autodesk.Revit.DB import *
clr.AddReference("RevitAPIUI")
from Autodesk.Revit.UI import TaskDialog
# Import DocumentManager and TransactionManager
clr.AddReference("RevitServices")
from RevitServices.Persistence import DocumentManager
from RevitServices.Transactions import TransactionManager
# Import ToProtoType, ToRevitType geometry conversion extension methods
clr.AddReference("RevitNodes")
import Revit
clr.ImportExtensions(Revit.Elements)
clr.ImportExtensions(Revit.GeometryConversion)
from System.Collections.Generic import *
import System

doc = DocumentManager.Instance.CurrentDBDocument
uiapp = DocumentManager.Instance.CurrentUIApplication
app = uiapp.Application




collector = FilteredElementCollector( doc ).WhereElementIsNotElementType()

cat = []

for c in collector:
	if (None != c.Category and c.Category.HasMaterialQuantities):
		cat.append(c)


category = [c.Category.Name for c in cat]


uniqueCategory = list(set(category))


#typeIds = [c.GetTypeId() for c in cat]
#unique = list(set(typeIds))

indexes = []

f = lambda my_list, value:filter(lambda x: my_list[x] == value, range(len(my_list)))

for x in uniqueCategory:
	indexes.append(f(category, x))

result = []

for i in indexes:
	sub = []
	result.append(sub)
	for j in i:
		sub.append(cat[j])

OUT = result, [r[0].GetType().Name for r in result], indexes, uniqueCategory
# ----------------------------------------
code_block = CodeBlock(a=python_script) { a[0]; }
count = List.Count(code_block, lacing=Longest)
code_block_2 = CodeBlock(a=count) { 1..a; }
boolean = BoolSelector(true)
python_script_2 = Python(IN[0]=code_block, IN[1]=code_block_2, IN[2]=boolean)
# ---------- python_script_2.python (53 lines) ----------
import clr
# Import RevitAPI
clr.AddReference("RevitAPI")
from Autodesk.Revit.DB import *
clr.AddReference("RevitAPIUI")
from Autodesk.Revit.UI import TaskDialog
# Import DocumentManager and TransactionManager
clr.AddReference("RevitServices")
from RevitServices.Persistence import DocumentManager
from RevitServices.Transactions import TransactionManager
# Import ToProtoType, ToRevitType geometry conversion extension methods
clr.AddReference("RevitNodes")
import Revit
clr.ImportExtensions(Revit.Elements)
clr.ImportExtensions(Revit.GeometryConversion)
from System.Collections.Generic import *
import System

doc = DocumentManager.Instance.CurrentDBDocument
uiapp = DocumentManager.Instance.CurrentUIApplication
app = uiapp.Application



elements = UnwrapElement(IN[0])

locCode = IN[1]


model_cat = []
error = []

count = 0
total = 0

if IN[2] == True:
	TransactionManager.Instance.EnsureInTransaction(doc)
	for i in range(0,len(elements)):
		for j in range(0,len(elements[i])):
			total +=1
			try:
				locationCode = elements[i][j].get_Parameter("Object ID Number")
				locationCode.Set(locCode[i][j])
				count +=1
			except:
				error.append(elements[i][j])
		
		TransactionManager.Instance.TransactionTaskDone()
		OUT  = str(count)+"/"+str(total)+" modified", error
else:
	OUT = "Set true to run"

#OUT = model_cat, [c.Name for c in model_cat], elements
# ----------------------------------------

# group: Element Types not modified
code_block_3 = CodeBlock(a=python_script_2) { a[1]; }
name = Element.Name(code_block_3)

# group: Category Checker
select_model_element = DSModelElementSelection()  # 1 picked in the model
python_script_3 = Python(IN[0]=select_model_element)
# ---------- python_script_3.python (50 lines) ----------
import clr
# Import RevitAPI
clr.AddReference("RevitAPI")
from Autodesk.Revit.DB import *
clr.AddReference("RevitAPIUI")
from Autodesk.Revit.UI import TaskDialog
# Import DocumentManager and TransactionManager
clr.AddReference("RevitServices")
from RevitServices.Persistence import DocumentManager
from RevitServices.Transactions import TransactionManager
# Import ToProtoType, ToRevitType geometry conversion extension methods
clr.AddReference("RevitNodes")
import Revit
clr.ImportExtensions(Revit.Elements)
clr.ImportExtensions(Revit.GeometryConversion)
from System.Collections.Generic import *
import System

doc = DocumentManager.Instance.CurrentDBDocument
uiapp = DocumentManager.Instance.CurrentUIApplication
app = uiapp.Application

categories = doc.Settings.Categories;

bics = System.Enum.GetValues(BuiltInCategory)

elements = [UnwrapElement(IN[0])]

# Element Type Id of elements
id = [ e.GetTypeId() for e in elements]

#eid = []

# Unique Type Ids
uniqueTypesIds = list(set(id))

type = []

for i in uniqueTypesIds:
	try:
		eleType = doc.GetElement( i )
		if eleType != None:
			type.append(eleType.Category.Name)
#			eid.append(eleType.Name)
	except:
		continue

OUT = type
#OUT = model_cat, [c.Name for c in model_cat], elements
#OUT  = type, model_cat, builtInCats, elements, eid, uniqueTypesIds
# ----------------------------------------

# group: Unique Categories
code_block_4 = CodeBlock(a=python_script) { a[3]; }
