# Dynamo graph SetElementTypeParameters.dyn (Dynamo 0.8.2.2392)

# group: Categories Excluded
code_block = CodeBlock()
# ---------- code_block.designscript (4 lines) ----------
{"Tag","View","ViewFamilyType","Level","Site","Dimension","Matchline",
"Region","Clouds","Cameras", "Legend","Lines","Analy","Elevation","Text",
"Sheet","Spot","Grid","Section","Material","TitleBlocks","Images",
"Project Information"};
# ----------------------------------------

code_block_2 = CodeBlock { {"OST_GenericModel","OST_PipeAccessory","OST_DuctSystem","OST_CableTray"}; }
python_script = Python(IN[0]=code_block, IN[1]=code_block_2)
# ---------- python_script.python (78 lines) ----------
import clr
# Import RevitAPI
clr.AddReference("RevitAPI")
from Autodesk.Revit.DB import *
clr.AddReference("RevitAPIUI")
from Autodesk.Revit.UI import TaskDialog
# Import DocumentManager and TransactionManager
clr.AddReference("RevitServices")
from RevitServices.Persistence import DocumentManager
from RevitServices.Transactions import TransactionManager
# Import ToProtoType, ToRevitType geometry conversion extension methods
clr.AddReference("RevitNodes")
import Revit
clr.ImportExtensions(Revit.Elements)
clr.ImportExtensions(Revit.GeometryConversion)
from System.Collections.Generic import *
import System

doc = DocumentManager.Instance.CurrentDBDocument
uiapp = DocumentManager.Instance.CurrentUIApplication
app = uiapp.Application

categories = doc.Settings.Categories;

bics = System.Enum.GetValues(BuiltInCategory)

exclude = IN[0]

#Selected Categories
model_cat = IN[1]


#Selected BuiltInCategories (equivalent of model_cat). To be used to select the elements
builtInCats = List[BuiltInCategory]()



for c in categories:
	if any(e in c.Name for e in exclude):
		"skip"
	else:
		name = (c.Name).replace(' ','')
		model_cat.append("OST_"+name)


for b in bics:
	if b.ToString() in model_cat:
		builtInCats.Add(b)



filter1 = ElementMulticategoryFilter(builtInCats)

# All elements of Selected Categories
elements = FilteredElementCollector(doc).WherePasses(filter1).ToElements() 

# Element Type Id of elements
id = [ e.GetTypeId() for e in elements]

#eid = []

# Unique Type Ids
uniqueTypesIds = list(set(id))

type = []

for i in uniqueTypesIds:
	try:
		eleType = doc.GetElement( i )
		if eleType != None:
			type.append(eleType)
#			eid.append(eleType.Name)
	except:
		continue

OUT = type
#OUT = model_cat, [c.Name for c in model_cat], elements
#OUT  = type, model_cat, builtInCats, elements, eid, uniqueTypesIds
# ----------------------------------------
code_block_3 = CodeBlock { "1F4"; }
code_block_4 = CodeBlock { "1F4_Discipline"; }
boolean = BoolSelector(false)
python_script_2 = Python(IN[0]=python_script, IN[1]=code_block_3, IN[2]=code_block_4, IN[3]=boolean)
# ---------- python_script_2.python (55 lines) ----------
import clr
# Import RevitAPI
clr.AddReference("RevitAPI")
from Autodesk.Revit.DB import *
clr.AddReference("RevitAPIUI")
from Autodesk.Revit.UI import TaskDialog
# Import DocumentManager and TransactionManager
clr.AddReference("RevitServices")
from RevitServices.Persistence import DocumentManager
from RevitServices.Transactions import TransactionManager
# Import ToProtoType, ToRevitType geometry conversion extension methods
clr.AddReference("RevitNodes")
import Revit
clr.ImportExtensions(Revit.Elements)
clr.ImportExtensions(Revit.GeometryConversion)
from System.Collections.Generic import *
import System

doc = DocumentManager.Instance.CurrentDBDocument
uiapp = DocumentManager.Instance.CurrentUIApplication
app = uiapp.Application



types = UnwrapElement(IN[0])

locCode = IN[1]
disCode = IN[2]

model_cat = []
error = []

count = 0

if IN[3] == True:
	TransactionManager.Instance.EnsureInTransaction(doc)	
	for t in types:
		try:
			locationCode = t.get_Parameter("Location Code")
			locationCode.Set(locCode)
		except:
			error.append(t)
		try:
			discipline = t.get_Parameter("Discipline")
			discipline.Set(disCode)
			count +=1
		except:
			error.append(t)
	
	TransactionManager.Instance.TransactionTaskDone()
	OUT  = str(count)+"/"+str(len(types))+" modified", error
else:
	OUT = "Set true to run"

#OUT = model_cat, [c.Name for c in model_cat], elements
# ----------------------------------------

# group: Element Types not modified
code_block_5 = CodeBlock(a=python_script_2) { a[1]; }
name = Element.Name(code_block_5)

# group: Category Checker
select_model_element = DSModelElementSelection()  # 1 picked in the model
python_script_3 = Python(IN[0]=select_model_element)
# ---------- python_script_3.python (50 lines) ----------
import clr
# Import RevitAPI
clr.AddReference("RevitAPI")
from Autodesk.Revit.DB import *
clr.AddReference("RevitAPIUI")
from Autodesk.Revit.UI import TaskDialog
# Import DocumentManager and TransactionManager
clr.AddReference("RevitServices")
from RevitServices.Persistence import DocumentManager
from RevitServices.Transactions import TransactionManager
# Import ToProtoType, ToRevitType geometry conversion extension methods
clr.AddReference("RevitNodes")
import Revit
clr.ImportExtensions(Revit.Elements)
clr.ImportExtensions(Revit.GeometryConversion)
from System.Collections.Generic import *
import System

doc = DocumentManager.Instance.CurrentDBDocument
uiapp = DocumentManager.Instance.CurrentUIApplication
app = uiapp.Application

categories = doc.Settings.Categories;

bics = System.Enum.GetValues(BuiltInCategory)

elements = [UnwrapElement(IN[0])]

# Element Type Id of elements
id = [ e.GetTypeId() for e in elements]

#eid = []

# Unique Type Ids
uniqueTypesIds = list(set(id))

type = []

for i in uniqueTypesIds:
	try:
		eleType = doc.GetElement( i )
		if eleType != None:
			type.append(eleType.Category.Name)
#			eid.append(eleType.Name)
	except:
		continue

OUT = type
#OUT = model_cat, [c.Name for c in model_cat], elements
#OUT  = type, model_cat, builtInCats, elements, eid, uniqueTypesIds
# ----------------------------------------
