# Dynamo graph SetGridExtents01.dyn (Dynamo 2.0.1.4955)

# group: ANNOTATION
# note: USE:
# FOR COMMENTS AND IMPORTANT INFO
# note: ANNOTATION

# group: CONTROL
# note: USE:
# FOR VARIABLE CONTROL INPUTS
# SUCH AS SLIDERS
# note: CONTROL

# group: MONITOR
# note: USE:
# FOR IMPORTANT WATCH NODES
# note: MONITOR

# group: INPUT
# note: USE:
# FOR FIXED INPUTS SUCH AS FILE PATHS
# note: INPUT

# group: TO REVIT
# note: USE:
# FOR NODE BLOCKS THAT EXPORTS GEOMETRY
# AND PARAMETERS TO REVIT
# note: TO REVIT

# group: Shortest Path
# note: DYNAMO VERSION: DYNAMO 1.3
# PACKAGES REQUIRED TO RUN:
# - SPRING NODES
# - LUNCHBOX

# group: Select Grids to modify
select_model_elements = DSModelElementsSelection()  # 15 picked in the model; graph input

current = Document.Current()
activeView = Document.ActiveView(document=current)

# group: Select Alignment Lines
boolean = BoolSelector(true)  # graph input
pick_model_elements = Custom[Pick Model Elements](refresh=boolean)  # This node offers a pick method for selecting elements in Revit.

geometry = Element.Geometry(element=pick_model_elements)
curve = Grid.Curve(grid=select_model_elements)
code_block = CodeBlock(curve=curve) { curve[0]; }
startPoint = Curve.StartPoint(curve=code_block)
byOriginNormal = Plane.ByOriginNormal(origin=startPoint)
pullOntoPlane = Curve.PullOntoPlane(curve=geometry@L1, plane=byOriginNormal, lacing=Longest)
intersectAll = Geometry.IntersectAll(geometry=pullOntoPlane@L1, others=curve, lacing=CrossProduct)
flatten = List.Flatten(list=intersectAll@L3)
transpose = List.Transpose(lists=flatten)
deconstruct = List.Deconstruct(list=transpose@L2)
byStartPointEndPoint = Line.ByStartPointEndPoint(startPoint=deconstruct.first, endPoint=deconstruct.rest)
flatten_2 = List.Flatten(list=byStartPointEndPoint)
code_block_2 = CodeBlock { Vector.ZAxis(); }
python_script = Python(IN[0]=select_model_elements, IN[1]=activeView)
# ---------- python_script.python (43 lines) ----------
import clr
clr.AddReference('ProtoGeometry')
from Autodesk.DesignScript.Geometry import *

# Import DocumentManager and TransactionManager
clr.AddReference("RevitServices")
import RevitServices
from RevitServices.Persistence import DocumentManager
from RevitServices.Transactions import TransactionManager

# Import RevitAPI
clr.AddReference("RevitAPI")
import Autodesk
from Autodesk.Revit.DB import *

clr.AddReference("RevitNodes")
import Revit
clr.ImportExtensions(Revit.GeometryConversion)


doc = DocumentManager.Instance.CurrentDBDocument
uiapp = DocumentManager.Instance.CurrentUIApplication
app = uiapp.Application


grids = UnwrapElement(IN[0])
view = UnwrapElement(IN[1])

gridCurves = []
curves = []


for g in grids:
	gridCurves.append(g.GetCurvesInView(DatumExtentType.Model, view))

for i in range(0,len(gridCurves)):
	for c in gridCurves[i]:
		start = c.GetEndPoint(0)
		end = c.GetEndPoint(1)
		curves.append(Line.CreateBound(start,end).ToProtoType())

#Assign your outputs to the OUT variable
OUT = curves
# ----------------------------------------
endPoints = Geometry.Curves.EndPoints(curve=python_script)
code_block_3 = CodeBlock(a=endPoints.StartPoint) { a[0].Z; }
translate = Geometry.Translate(geometry=flatten_2, direction=code_block_2, distance=code_block_3)
flatten_3 = List.Flatten(list=translate)
endPoints_2 = Geometry.Curves.EndPoints(curve=flatten_3)

# group: Invert start and end point to change head position
python_script_2 = Python(IN[0]=endPoints_2.StartPoint, IN[1]=endPoints_2.EndPoint)
# ---------- python_script_2.python (36 lines) ----------
import clr
clr.AddReference('ProtoGeometry')
from Autodesk.DesignScript.Geometry import *

# Import DocumentManager and TransactionManager
clr.AddReference("RevitServices")
import RevitServices
from RevitServices.Persistence import DocumentManager
from RevitServices.Transactions import TransactionManager

# Import RevitAPI
clr.AddReference("RevitAPI")
import Autodesk
from Autodesk.Revit.DB import *

clr.AddReference("RevitNodes")
import Revit
clr.ImportExtensions(Revit.GeometryConversion)


doc = DocumentManager.Instance.CurrentDBDocument
uiapp = DocumentManager.Instance.CurrentUIApplication
app = uiapp.Application


startPts = UnwrapElement(IN[0])
endPts = UnwrapElement(IN[1])
revitCurves = []

  
for i in range(0,len(startPts)):
	newLine = Line.CreateBound(startPts[i].ToXyz(),endPts[i].ToXyz())
	revitCurves.append(newLine)
    
#Assign your outputs to the OUT variable
OUT = revitCurves
# ----------------------------------------

# group: Set GridLines
python_script_3 = Python(IN[0]=select_model_elements, IN[1]=activeView, IN[2]=python_script_2)
# ---------- python_script_3.python (44 lines) ----------
import clr
clr.AddReference('ProtoGeometry')
from Autodesk.DesignScript.Geometry import *

# Import DocumentManager and TransactionManager
clr.AddReference("RevitServices")
import RevitServices
from RevitServices.Persistence import DocumentManager
from RevitServices.Transactions import TransactionManager

# Import RevitAPI
clr.AddReference("RevitAPI")
import Autodesk
from Autodesk.Revit.DB import *

clr.AddReference("RevitNodes")
import Revit
clr.ImportExtensions(Revit.GeometryConversion)


doc = DocumentManager.Instance.CurrentDBDocument
uiapp = DocumentManager.Instance.CurrentUIApplication
app = uiapp.Application


grids = UnwrapElement(IN[0])
view = UnwrapElement(IN[1])
crvs = UnwrapElement(IN[2])

curves = []
curvesViews = []

TransactionManager.Instance.EnsureInTransaction(doc)

for i in range(0,len(grids)):	
	grids[i].SetCurveInView(DatumExtentType.ViewSpecific,view,crvs[i])


TransactionManager.Instance.TransactionTaskDone()
	

	
#Assign your outputs to the OUT variable
OUT = grids
# ----------------------------------------
