# Dynamo graph SortCurves01.dyn (Dynamo 1.3.1.1736)

select_model_elements = DSModelElementsSelection()  # 6 picked in the model
curves = Element.Curves(select_model_elements)
flatten = Flatten(curves)
intersectAll = Curve.IntersectAll(flatten)
python_script = Python(IN[0]=flatten, IN[1]=intersectAll)
# ---------- python_script.python (40 lines) ----------
import clr
clr.AddReference('ProtoGeometry')
from Autodesk.DesignScript.Geometry import *

clr.AddReference('System')
from System.Collections.Generic import List
#The inputs to this node will be stored as a list in the IN variables.
crvs = IN[0]
intersectionPts = IN[1]

pts = List[Point]()

for c in crvs:
	pts.Add(c.PointAtParameter(0))
	pts.Add(c.PointAtParameter(1))
"""
lines = []

for c in crvs:
	for p in intersectionPts:
		if c.DistanceTo(p)<0.1:
			lines.append(c.SplitByPoints([p]))
"""
dist = []
newCurves = []

for i in range(0,len(intersectionPts)):
	distPartial = []
	dist.append(distPartial)
	nC = []
	newCurves.append(nC)
	for c in crvs:
		if intersectionPts[i].DistanceTo(c)<0.1:
			distPartial.append(intersectionPts[i].DistanceTo(c))
			nC.append(c.SplitByPoints([intersectionPts[i]]))

#Assign your output to the OUT variable.
OUT = pts[0],dist,newCurves

#OUT = lines
# ----------------------------------------
code_block = CodeBlock(a=flatten) { a[0]; }  # frozen
python_script_2 = Python(IN[0]=code_block)
# ---------- python_script_2.python (24 lines) ----------
import clr
clr.AddReference('ProtoGeometry')
from Autodesk.DesignScript.Geometry import *

clr.AddReference('System')
from System.Collections.Generic import List



#The inputs to this node will be stored as a list in the IN variables.
crvs = IN[0]

pts = List[Point]()


pts.Add(crvs.PointAtParameter(0.5))
pts.Add(crvs.PointAtParameter(0.8))

split = crvs.SplitByPoints(pts)



#Assign your output to the OUT variable.
OUT = split
# ----------------------------------------
splitByPoints = Curve.SplitByPoints(curve=flatten, points=intersectAll)
flatten_2 = Flatten(splitByPoints)
length = Curve.Length(flatten_2)
removeNulls = Lists.Manage.RemoveNulls(length)
removeItemAtIndex = List.RemoveItemAtIndex(list=flatten_2, indices=removeNulls.out1)
code_block_2 = CodeBlock(a=removeNulls.out0) { a>1; }
filterByBoolMask = List.FilterByBoolMask(list=removeItemAtIndex, mask=code_block_2)
code_block_3 = CodeBlock { {0,1}; }
pointAtParameter = Curve.PointAtParameter(curve=filterByBoolMask.in, param=code_block_3, lacing=CrossProduct)
distanceTo = Geometry.DistanceTo(geometry=intersectAll, other=pointAtParameter, lacing=CrossProduct)
code_block_4 = CodeBlock(a=distanceTo) { a==0; }
countTrue = CountTrue(code_block_4, lacing=Longest)
length_2 = Curve.Length(filterByBoolMask.in)

# group: Select Pipe Type
select_model_elements_2 = DSModelElementsSelection()  # 1 picked in the model

code_block_5 = CodeBlock { "Type"; }
getParameterValueByName = Element.GetParameterValueByName(element=select_model_elements_2, parameterName=code_block_5)
watch = Watch(getParameterValueByName)
code_block_6 = CodeBlock { "System Type"; }
getParameterValueByName_2 = Element.GetParameterValueByName(element=select_model_elements_2, parameterName=code_block_6)
watch_2 = Watch(getParameterValueByName_2)
levels = Levels("00")
code_block_7 = CodeBlock { 100; }
byLines = Custom[Pipe.ByLines](Lines=flatten, PipeType=watch, SystemType=watch_2, Level=levels, Diameter=code_block_7)  # Creates a pipe by Line, PipeType, SystemType, Level and Diameter
parameters = Element.Parameters(select_model_elements_2)
watch_3 = Watch(parameters)
python_script_3 = Python(IN[0]=select_model_elements_2)
# ---------- python_script_3.python (25 lines) ----------
import clr

clr.AddReference("RevitServices")
import RevitServices
from RevitServices.Persistence import DocumentManager
from RevitServices.Transactions import TransactionManager
doc = DocumentManager.Instance.CurrentDBDocument

clr.AddReference("RevitAPI")
import Autodesk
from Autodesk.Revit.DB import *

clr.AddReference("RevitNodes")
import Revit
clr.ImportExtensions(Revit.Elements)
clr.ImportExtensions(Revit.GeometryConversion)

toggle = ""

pipe = UnwrapElement(IN[0])

mepS= pipe.MEPSystem.GetTypeId();


OUT = mepS
# ----------------------------------------
by2MEPCurves = Custom[Tee.By2MEPCurves]()  # Creates a tee by a main curve and a branch MEP curve (duct, pipe, conduit, cable tray). Only works with perpendicular brand curves; unwired: Main_MEPCurve, Branch_MEPCurve
