# Dynamo graph Split Columns10.dyn (Dynamo 1.3.1.1736)

categories = Categories("StructuralColumns")
all_elements_of_category = ElementsOfCategory(categories)
categories_2 = Categories("Floors")
all_elements_of_category_2 = ElementsOfCategory(categories_2)
code_block = CodeBlock { 0.05; }
getSurroundingElements = Custom[Tool.GetSurroundingElements](Element=all_elements_of_category, ElementCheck=all_elements_of_category_2, Tolerance=code_block)  # Get Surrounding Elements by Categories, group them as List. Tolerance distance available.
deconstruct = List.Deconstruct(list=getSurroundingElements, lacing=Longest)
count = Count(deconstruct.first)
# note: Floors
boundingBox = Geometry.BoundingBox(deconstruct.rest, lacing=Longest)
maxPoint = BoundingBox.MaxPoint(boundingBox)
Z = Point.Z(maxPoint)
code_block_2 = CodeBlock { false; }
sortIndexByValue = SortIndexByValue(Z, code_block_2, lacing=Longest)
dropLastItem = Custom[List.DropLastItem](list=sortIndexByValue, lacing=Longest)  # Drops the last item from a given list.
getItemAtIndex = List.GetItemAtIndex(list=deconstruct.rest, index=dropLastItem, lacing=Longest)
getItemAtIndex_2 = List.GetItemAtIndex(list=Z, index=dropLastItem, lacing=Longest)
# note: L3-L2-L1
python_script = Python(IN[0]=getItemAtIndex_2)
# ---------- python_script.python (17 lines) ----------
import clr
clr.AddReference('ProtoGeometry')
from Autodesk.DesignScript.Geometry import *
#The inputs to this node will be stored as a list in the IN variables.
list = IN[0]
newList = []

for i in range(0,len(list)):
	nL = []
	newList.append(nL)
	if len(list[i])>1:
		for j in range(0,len(list[i])-1):
			nL.append(list[i][j]-list[i][j+1])
	else:
		nL.append(list[i][0])
#Assign your output to the OUT variable.
OUT = newList
# ----------------------------------------
# note: Columns
boundingBox_2 = Geometry.BoundingBox(deconstruct.first, lacing=Longest)
maxPoint_2 = BoundingBox.MaxPoint(boundingBox_2)
minPoint = BoundingBox.MinPoint(boundingBox_2)
# note: Column Length
code_block_3 = CodeBlock(maxPoint_2, minPoint) { TopPt.Z-BottomPt.Z; }
python_script_2 = Python(IN[0]=getItemAtIndex_2, IN[1]=code_block_3)
# ---------- python_script_2.python (10 lines) ----------
lista = IN[0]
colLength = IN[1]

for i in range(0,len(lista)):
	if len(lista[i])>1:
		lista[i] = lista[i][:len(lista[i])-1]
	else:
		lista[i] = [colLength[i]]

OUT = lista
# ----------------------------------------
code_block_4 = CodeBlock(minPoint) { Pt.Z; }
sub = python_script_2 - code_block_4  # lacing=Longest
div = python_script / sub  # lacing=Longest

# group: SPLIT BEAMS
code_block_5 = CodeBlock(a=deconstruct.first) { a; }
code_block_6 = CodeBlock(a=div) { 1-a; }
python_script_3 = Python(IN[0]=code_block_5, IN[1]=code_block_6)
# ---------- python_script_3.python (37 lines) ----------
import clr
 
clr.AddReference("RevitServices")
import RevitServices
from RevitServices.Persistence import DocumentManager
from RevitServices.Transactions import TransactionManager
doc =  DocumentManager.Instance.CurrentDBDocument

clr.AddReference("RevitNodes")
import Revit
clr.ImportExtensions(Revit.Elements)
clr.ImportExtensions(Revit.GeometryConversion)

clr.AddReference("RevitAPI")
from Autodesk.Revit.DB import *

# Import System Collections...
import System
from System.Collections.Generic import *

 

col = UnwrapElement(IN[0])
splitValues = IN[1]


outList = []

for j in range(0,len(col)):
	oL = []
	outList.append(oL)
	for i in range(0,len(splitValues[j])):
		TransactionManager.Instance.EnsureInTransaction(doc)
		oL.append(doc.GetElement(col[j].Split(splitValues[j][i])))
		TransactionManager.Instance.TransactionTaskDone()

OUT = outList
# ----------------------------------------

getItemAtIndex_3 = List.GetItemAtIndex(list=deconstruct.rest, index=sortIndexByValue, lacing=Longest)

# group: ATTACH COLUMNS
code_block_7 = CodeBlock(a=getItemAtIndex) { a; }
addItemToEnd = List.AddItemToEnd(item=code_block_5, list=python_script_3, lacing=Longest)
python_script_4 = Python(IN[0]=code_block_7, IN[1]=addItemToEnd)
# ---------- python_script_4.python (44 lines) ----------
import clr
 
clr.AddReference("RevitServices")
import RevitServices
from RevitServices.Persistence import DocumentManager
from RevitServices.Transactions import TransactionManager
doc =  DocumentManager.Instance.CurrentDBDocument

clr.AddReference("RevitNodes")
import Revit
clr.ImportExtensions(Revit.Elements)
clr.ImportExtensions(Revit.GeometryConversion)

clr.AddReference("RevitAPI")
from Autodesk.Revit.DB import *
from Autodesk.Revit.DB import ColumnAttachment

# Import System Collections...
import System
from System.Collections.Generic import *
from System import Enum

 

target = UnwrapElement(IN[0])
column = UnwrapElement(IN[1])

result = []

TransactionManager.Instance.EnsureInTransaction(doc)

cSt = ColumnAttachmentCutStyle.CutColumn
cAt = ColumnAttachmentJustification.Minimum

for i in range(0,len(target)):
	l3 = []
	result.append(l3)
	for t,c in zip(target[i],column[i]):
		ca = ColumnAttachment.AddColumnAttachment(doc,c,t,1,cSt,cAt,0)
		l3.append(ca)

TransactionManager.Instance.TransactionTaskDone()

OUT = result
# ----------------------------------------
restOfItems = List.RestOfItems(getItemAtIndex_3, lacing=Longest)
python_script_5 = Python(IN[0]=restOfItems, IN[1]=addItemToEnd)
# ---------- python_script_5.python (44 lines) ----------
import clr
 
clr.AddReference("RevitServices")
import RevitServices
from RevitServices.Persistence import DocumentManager
from RevitServices.Transactions import TransactionManager
doc =  DocumentManager.Instance.CurrentDBDocument

clr.AddReference("RevitNodes")
import Revit
clr.ImportExtensions(Revit.Elements)
clr.ImportExtensions(Revit.GeometryConversion)

clr.AddReference("RevitAPI")
from Autodesk.Revit.DB import *
from Autodesk.Revit.DB import ColumnAttachment

# Import System Collections...
import System
from System.Collections.Generic import *
from System import Enum

 

target = UnwrapElement(IN[0])
column = UnwrapElement(IN[1])

result = []

TransactionManager.Instance.EnsureInTransaction(doc)

cSt = ColumnAttachmentCutStyle.CutColumn
cAt = ColumnAttachmentJustification.Minimum

for i in range(0,len(target)):
	l3 = []
	result.append(l3)
	for t,c in zip(target[i],column[i]):
		ca = ColumnAttachment.AddColumnAttachment(doc,c,t,0,cSt,cAt,0)
		l3.append(ca)

TransactionManager.Instance.TransactionTaskDone()

OUT = result
# ----------------------------------------

# group: OVERRIDE COLOURS
code_block_8 = CodeBlock(a=addItemToEnd) { rnd_col(a); }
overrideColorInView = Element.OverrideColorInView(element=addItemToEnd, color=code_block_8, lacing=Longest)

code_block_9 = CodeBlock { def rnd1(){return = Math.Random(0,255); }; def rnd_col(x){return = DSCore.Color.ByARGB(255,rnd1(),rnd1(),rnd1()); }; }
select_model_elements = DSModelElementsSelection()
