# Dynamo graph SplitWall.dyn (Dynamo 2.1.0.5696)

# group: Select the walls to split
select_model_elements = DSModelElementsSelection()  # 1 picked in the model

code_block = CodeBlock { 1; }
getLocation = Element.GetLocation(element=select_model_elements)

# group: Get the wall base level
categories = Categories(index=245)
all_elements_of_category = ElementsOfCategory(Category=categories)
code_block_2 = CodeBlock { "Base Constraint"; }
getParameterValueByName = Element.GetParameterValueByName(element=select_model_elements, parameterName=code_block_2)
allIndicesOf = List.AllIndicesOf(list=all_elements_of_category, item=getParameterValueByName)

# group: Get the wall top level
code_block_3 = CodeBlock { "Top Constraint"; }

getParameterValueByName_2 = Element.GetParameterValueByName(element=select_model_elements, parameterName=code_block_3)

# group (continued): Get the wall top level
allIndicesOf_2 = List.AllIndicesOf(list=all_elements_of_category, item=getParameterValueByName_2)

# group: Get all the base levels between base and top
python_script = Python(IN[0]=allIndicesOf, IN[1]=allIndicesOf_2)
# ---------- python_script.python (17 lines) ----------
base = IN[0]
top = IN[1]


result = []

for b,t in zip(base, top):
	sub = []
	result.append(sub)
	try:
		for i in range(b[0], t[0]):
			sub.append(i)
	except:
		for i in range(b, t):
			sub.append(i)

OUT = result
# ----------------------------------------
getItemAtIndex = List.GetItemAtIndex(list=all_elements_of_category, index=python_script)

# group: Get all the top levels between base and top
python_script_2 = Python(IN[0]=allIndicesOf, IN[1]=allIndicesOf_2)
# ---------- python_script_2.python (16 lines) ----------
base = IN[0]
top = IN[1]

result = []

for b,t in zip(base, top):
	sub = []
	result.append(sub)
	try:
		for i in range(b[0], t[0]):
			sub.append(i+1)
	except:
		for i in range(b, t):
			sub.append(i+1)

OUT = result
# ----------------------------------------
getItemAtIndex_2 = List.GetItemAtIndex(list=all_elements_of_category, index=python_script_2)

name = WallType.Name(wallType=select_model_elements)
byName = WallType.ByName(name=name)

# group: Create the walls
byCurveAndLevels = Wall.ByCurveAndLevels(c=getLocation, startLevel=getItemAtIndex, endLevel=getItemAtIndex_2, wallType=byName)

flatten = List.Flatten(list=byCurveAndLevels)
flatten_2 = List.Flatten(list=getItemAtIndex_2)
code_block_4 = CodeBlock { true; }
count = List.Count(list=getItemAtIndex_2, lacing=Longest)
ofRepeatedItem = List.OfRepeatedItem(item=code_block_4, amount=count)
flatten_3 = List.Flatten(list=ofRepeatedItem)

# group: Set the wall to structural
code_block_5 = CodeBlock { ["Top Constraint", "Structural"]; }
code_block_6 = CodeBlock(top=flatten_2, structural=flatten_3) { [top,structural]; }

transpose = List.Transpose(lists=code_block_6)

# group (continued): Set the wall to structural
setParameterByName = Element.SetParameterByName(element=flatten, parameterName=code_block_5@L2, value=transpose, lacing=Longest)

# group: Unjoin the walls
flatten_4 = List.Flatten(list=setParameterByName)
python_script_3 = Python(IN[0]=flatten_4)
# ---------- python_script_3.python (31 lines) ----------
import clr
clr.AddReference('RevitAPI')
from Autodesk.Revit.DB import *
from System.Collections.Generic import *
clr.AddReference("RevitServices")
import RevitServices
from RevitServices.Persistence import DocumentManager
from RevitServices.Transactions import TransactionManager

doc = DocumentManager.Instance.CurrentDBDocument

#The inputs to this node will be stored as a list in the IN variables.
dataEnteringNode = IN

walls = UnwrapElement(IN[0])


TransactionManager.Instance.EnsureInTransaction(doc)
booleans=[]
for wall in walls:
	try:
		WallUtils.DisallowWallJoinAtEnd(wall, 0)
		WallUtils.DisallowWallJoinAtEnd(wall, 1)
		booleans.append(True)
	except:
		booleans.append(False)

TransactionManager.Instance.TransactionTaskDone()

#Assign your output to the OUT variable.
OUT = booleans
# ----------------------------------------

# group: Wait the wall are created before deleting the originals
code_block_7 = CodeBlock(passthrough=code_block, waitfor=python_script_3) { [passthrough,waitfor][0]; }

# group: Delete the original wall
python_script_4 = Python(IN[0]=select_model_elements, IN[1]=code_block_7)
# ---------- python_script_4.python (35 lines) ----------
#Copyright(c) 2016, Dimitar Venkov
# @5devene, dimitar.ven@gmail.com

import clr

clr.AddReference("RevitServices")
import RevitServices
from RevitServices.Persistence import DocumentManager
from RevitServices.Transactions import TransactionManager
doc = DocumentManager.Instance.CurrentDBDocument

def tolist(obj1):
	if hasattr(obj1,"__iter__"): return obj1
	else: return [obj1]

elems = UnwrapElement(tolist(IN[0]) )

if IN[1]:
	deleted, failed = [], []
	TransactionManager.Instance.EnsureInTransaction(doc)
	for e in elems:
		id = None
		try:
			id = e.Id
			del_id = doc.Delete(id)
			deleted.extend([d.ToString() for d in del_id])
		except:
			if id is not None:
				failed.append(id.ToString() )
	TransactionManager.Instance.TransactionTaskDone()
	s = set(deleted)
	failed1 = [x for x in failed if x not in s]
	OUT = len(deleted), ';'.join(deleted), ';'.join(failed1)
else:
	OUT = "Set confirm to True", "", ""
# ----------------------------------------
