# Dynamo graph TeklaWallLintelToTekla.dyn (Dynamo 1.3.2.2480)

select_model_element = DSModelElementSelection()  # 1 picked in the model
getLocation = Element.GetLocation(select_model_element)
python_script = Python(IN[0]=select_model_element)
# ---------- python_script.python (24 lines) ----------
import clr
clr.AddReference('RevitAPI')
import Autodesk
from Autodesk.Revit.DB import ElementTransformUtils, Plane

clr.AddReference("RevitServices")
import RevitServices
from RevitServices.Persistence import DocumentManager
from RevitServices.Transactions import TransactionManager

doc = DocumentManager.Instance.CurrentDBDocument

clr.AddReference("RevitNodes")
import Revit
clr.ImportExtensions(Revit.GeometryConversion)

clr.AddReference('ProtoGeometry')
from Autodesk.DesignScript.Geometry import *

walls = UnwrapElement(IN[0])


		
OUT = walls.GetAnalyticalModel()
# ----------------------------------------
geometry = Element.Geometry(python_script)
restOfItems = List.RestOfItems(geometry)
python_script_2 = Python(IN[0]=select_model_element, IN[1]=restOfItems)
# ---------- python_script_2.python (56 lines) ----------
import clr
clr.AddReference('RevitAPI')
import Autodesk
from Autodesk.Revit.DB import ElementTransformUtils, Plane

clr.AddReference("RevitServices")
import RevitServices
from RevitServices.Persistence import DocumentManager
from RevitServices.Transactions import TransactionManager

doc = DocumentManager.Instance.CurrentDBDocument

clr.AddReference("RevitNodes")
import Revit
clr.ImportExtensions(Revit.GeometryConversion)

clr.AddReference('ProtoGeometry')
from Autodesk.DesignScript.Geometry import *

revitWall = UnwrapElement(IN[0])

location = revitWall.Location.Curve.ToProtoType()

lines = UnwrapElement(IN[1])

wall = []
lintel = []

def GetParam(element, name):
	param = element.GetParameters(name)
	return param[0]

def HighestPoint(lines):
	highestPoint = []
	for l in lines:
		highestPoint.append(l.PointAtParameter(0.5).Z)
	return max(highestPoint)

def LintelSize(lintel):
	wallType = doc.GetElement(GetParam(revitWall, "Type").AsElementId())
	wallWidth = GetParam(wallType, "Width").AsValueString()
	height = [] 
	for l in lintel:
		height.append(int(HighestPoint(lines)-l.PointAtParameter(0).Z))
	return [str(h)+"*"+wallWidth for h in height]

for l in lines:
	if l.PointAtParameter(0.5).Z == location.PointAtParameter(0.5).Z:
		wall.append(l)
	elif l.PointAtParameter(0).Z != HighestPoint(lines) and l.PointAtParameter(1).Z == l.PointAtParameter(0).Z:
		lintel.append(l)
	else:
		""

		
OUT = wall, lintel, LintelSize(lintel)
# ----------------------------------------
code_block = CodeBlock(walls=python_script_2) { walls[0]; }
getType = WombatDynamo.Element.GetType(select_model_element)
code_block_2 = CodeBlock { "Width"; }
getParameterValueByName = Element.GetParameterValueByName(element=getType, parameterName=code_block_2)
python_script_3 = Python(IN[0]=select_model_element)
# ---------- python_script_3.python (27 lines) ----------
import clr
clr.AddReference('RevitAPI')
import Autodesk
from Autodesk.Revit.DB import ElementTransformUtils, Plane

clr.AddReference("RevitServices")
import RevitServices
from RevitServices.Persistence import DocumentManager
from RevitServices.Transactions import TransactionManager

doc = DocumentManager.Instance.CurrentDBDocument

clr.AddReference("RevitNodes")
import Revit
clr.ImportExtensions(Revit.GeometryConversion)

clr.AddReference('ProtoGeometry')
from Autodesk.DesignScript.Geometry import *

def GetParam(element, name):
	param = element.GetParameters(name)
	return param[0]

wall = UnwrapElement(IN[0])


OUT = int(GetParam(wall, "Unconnected Height").AsValueString())
# ----------------------------------------
id = Element.Id(select_model_element)
string_from_object = FromObject(id)
code_block_3 = CodeBlock { "Front"; }
overallPosition = Arup.DynaTekla.Positions.OverallPosition(code_block_3)
code_block_4 = CodeBlock { "Concrete_Undefined"; }
panel = Arup.DynaTekla.TeklaConcrete.Panel(code_block, getParameterValueByName, python_script_3, string_from_object, overallPosition, code_block_4)
code_block_5 = CodeBlock(lintel=python_script_2) { lintel[1]; }
code_block_6 = CodeBlock(lintelSize=python_script_2) { lintelSize[2]; }
code_block_7 = CodeBlock { "lintel"; }
code_block_8 = CodeBlock { "Front"; }
overallPosition_2 = Arup.DynaTekla.Positions.OverallPosition(code_block_8)
code_block_9 = CodeBlock { "Concrete_Undefined"; }
genericBeam = Arup.DynaTekla.TeklaConcrete.GenericBeam(code_block_5, code_block_6, code_block_7, overallPosition_2, code_block_9)
python_script_4 = Python(IN[0]=select_model_element)
# ---------- python_script_4.python (29 lines) ----------
import clr
clr.AddReference('RevitAPI')
import Autodesk
from Autodesk.Revit.DB import ElementTransformUtils, Plane

clr.AddReference("RevitServices")
import RevitServices
from RevitServices.Persistence import DocumentManager
from RevitServices.Transactions import TransactionManager

doc = DocumentManager.Instance.CurrentDBDocument

clr.AddReference("RevitNodes")
import Revit
clr.ImportExtensions(Revit.GeometryConversion)


clr.AddReference('ProtoGeometry')
from Autodesk.DesignScript.Geometry import *

def GetParam(element, name):
	param = element.GetParameters(name)
	return param[0]

wall = UnwrapElement(IN[0])

wallType = doc.GetElement(GetParam(wall, "Type").AsElementId())

OUT = int(GetParam(wallType, "Width").AsValueString())
# ----------------------------------------
byCurve = ModelCurve.ByCurve(code_block_5)
