# Dynamo graph UnitConverter.dyn (Dynamo 1.3.1.1736)

code_block = CodeBlock { {1,2,3}; }
code_block_2 = CodeBlock { "DUT_WATTS"; }
convertToInternalUnits = Python(IN[0]=code_block, IN[1]=code_block_2)
# ---------- convertToInternalUnits.python (34 lines) ----------
import clr
clr.AddReference('ProtoGeometry')
from Autodesk.DesignScript.Geometry import *
clr.AddReference('RevitAPI')
from Autodesk.Revit.DB import *

clr.AddReference("RevitServices")
import RevitServices
from RevitServices.Persistence import DocumentManager
from RevitServices.Transactions import TransactionManager
doc = DocumentManager.Instance.CurrentDBDocument
#The inputs to this node will be stored as a list in the IN variables.

values = IN[0]
test = IN[1]

index = []
newValues = []

units = UnitUtils.GetValidDisplayUnits()

for i in range(0,len(units)):
	if units[i].ToString() == test:
		index = i
"""
for v in values:
	newValues.append(UnitUtils.ConvertToInternalUnits(v,units[index]))
"""

for i in range(0,len(values)):
	newValues.append(UnitUtils.ConvertToInternalUnits(values[i],units[index]))

#Assign your output to the OUT variable.
OUT = newValues
# ----------------------------------------
internalUnitsList = Python()
# ---------- internalUnitsList.python (21 lines) ----------
import clr
clr.AddReference('ProtoGeometry')
from Autodesk.DesignScript.Geometry import *
clr.AddReference('RevitAPI')
from Autodesk.Revit.DB import *

clr.AddReference("RevitServices")
import RevitServices
from RevitServices.Persistence import DocumentManager
from RevitServices.Transactions import TransactionManager
doc = DocumentManager.Instance.CurrentDBDocument
#The inputs to this node will be stored as a list in the IN variables.



units = UnitUtils.GetValidDisplayUnits()



#Assign your output to the OUT variable.
OUT = units
# ----------------------------------------

# group: Find the Units for each parameter
select_model_element = DSModelElementSelection()  # 1 picked in the model
parameters = Element.Parameters(select_model_element)
name = Element.Name(parameters)
code_block_3 = CodeBlock { 1; }
python_script = Python(IN[0]=select_model_element, IN[1]=name, IN[2]=code_block_3)
# ---------- python_script.python (53 lines) ----------
import clr
clr.AddReference('ProtoGeometry')
from Autodesk.DesignScript.Geometry import *
clr.AddReference('RevitAPI')
from Autodesk.Revit.DB import *

clr.AddReference("RevitServices")
import RevitServices
from RevitServices.Persistence import DocumentManager
from RevitServices.Transactions import TransactionManager
doc = DocumentManager.Instance.CurrentDBDocument
#The inputs to this node will be stored as a list in the IN variables.

element = UnwrapElement(IN[0])
name = IN[1]
values = IN[2]

parameters = []
listout = []
newValues = []
PU = []
Display = []
US = UnitUtils.GetValidDisplayUnits()
removed = []

def checkParameter(param):
	for p in param:
		internal = p.Definition
		if internal.BuiltInParameter != BuiltInParameter.INVALID:
			return p
	return param[0]

for n in name:
	param = element.GetParameters(n)
	if len(param) == 0:
		parameters.append(None)
	else:
		p = checkParameter(param)
		parameters.append(p)
		listout.append(p.StorageType)
		listout.append(p.Definition)

for p in parameters:
	try:
		ProjectUnits = p.DisplayUnitType
		Names = str(p.Definition.Name) + "[" + str(p.StorageType) + "]"
		Display.append(Names)
		PU.append(ProjectUnits)
		newValues.append(UnitUtils.ConvertToInternalUnits(values,ProjectUnits))
	except:
		removed.append(p.Definition.Name)
#Assign your output to the OUT variable.
OUT = Display, PU, newValues, US, removed
# ----------------------------------------

# group: Parameters
code_block_4 = CodeBlock(a=python_script) { a[0]; }

# group: Units
code_block_5 = CodeBlock(a=python_script) { a[1]; }

# group: Conversion Factor
code_block_6 = CodeBlock(a=python_script) { a[2]; }
