# Dynamo graph Units.dyn (Dynamo 1.3.0.875)

code_block = CodeBlock()
# ---------- code_block.designscript (4 lines) ----------
def UT_HVAC_AirFlow(a)
{
return = a/28.31684;
};
# ----------------------------------------
code_block_2 = CodeBlock { 50; }
code_block_3 = CodeBlock(a=code_block_2) { UT_HVAC_AirFlow(a); }
select_model_element = DSModelElementSelection()  # 1 picked in the model

# group: Revit Project Units - Get
code_block_4 = CodeBlock { "Additional Flow"; }
getParameterAsProjectUnits = Custom[GetParameterAsProjectUnits](Elements=select_model_element, ParameterName=code_block_4)  # Returns the parameter value in the same unit type as the project settings

# group: Revit Project Units - Set
select_model_element_2 = DSModelElementSelection()  # 1 picked in the model
code_block_5 = CodeBlock { "Additional Flow"; }
code_block_6 = CodeBlock { 300; }
setParameterAsProjectUnits = Custom[SetParameterAsProjectUnits](Elements=select_model_element_2, ParameterName=code_block_5, Values=code_block_6)  # Sets the parameters by project unit inputs, no need to convert to Revit internal units first.

# group: Revit Internal Units - Get
code_block_7 = CodeBlock { "Additional Flow"; }
getParameterValueByName = Element.GetParameterValueByName(element=select_model_element, parameterName=code_block_7)

select_model_element_3 = DSModelElementSelection()  # 1 picked in the model
parameters = Element.Parameters(select_model_element_3)
code_block_8 = CodeBlock(a=parameters) { a[17]; }
code_block_9 = CodeBlock { {100,300}; }
python_script = Python(IN[0]=code_block_8, IN[1]=code_block_9)
# ---------- python_script.python (24 lines) ----------
import clr
clr.AddReference('ProtoGeometry')
from Autodesk.DesignScript.Geometry import *
clr.AddReference('RevitAPI')
from Autodesk.Revit.DB import *

clr.AddReference("RevitServices")
import RevitServices
from RevitServices.Persistence import DocumentManager
from RevitServices.Transactions import TransactionManager
doc = DocumentManager.Instance.CurrentDBDocument
#The inputs to this node will be stored as a list in the IN variables.

param = UnwrapElement(IN[0])

values = IN[1]

listout = []
newValues = []


	
#Assign your output to the OUT variable.
OUT = DisplayUnitType.DUT_GALLONS_US
# ----------------------------------------
convertToInternalUnits = Python(IN[0]=code_block_9)
# ---------- convertToInternalUnits.python (25 lines) ----------
import clr
clr.AddReference('ProtoGeometry')
from Autodesk.DesignScript.Geometry import *
clr.AddReference('RevitAPI')
from Autodesk.Revit.DB import *

clr.AddReference("RevitServices")
import RevitServices
from RevitServices.Persistence import DocumentManager
from RevitServices.Transactions import TransactionManager
doc = DocumentManager.Instance.CurrentDBDocument
#The inputs to this node will be stored as a list in the IN variables.

values = IN[0]

listout = []
newValues = []


for v in values:
	ProjectUnits = DisplayUnitType.DUT_LITERS_PER_SECOND
	newValues.append(UnitUtils.ConvertToInternalUnits(v,ProjectUnits))
	
#Assign your output to the OUT variable.
OUT = newValues
# ----------------------------------------
code_block_10 = CodeBlock(a=convertToInternalUnits) { a[1]; }
toInternalUnit = Custom[DisplayUnit.ToInternalUnit](val=code_block_9, displayUnitType=code_block_10)  # Converts a value from a given display unit to Revit's internal unit
convertFromInternalUnits = Python(IN[0]=convertToInternalUnits)
# ---------- convertFromInternalUnits.python (25 lines) ----------
import clr
clr.AddReference('ProtoGeometry')
from Autodesk.DesignScript.Geometry import *
clr.AddReference('RevitAPI')
from Autodesk.Revit.DB import *

clr.AddReference("RevitServices")
import RevitServices
from RevitServices.Persistence import DocumentManager
from RevitServices.Transactions import TransactionManager
doc = DocumentManager.Instance.CurrentDBDocument
#The inputs to this node will be stored as a list in the IN variables.

values = IN[0]

listout = []
newValues = []


for v in values:
	ProjectUnits = DisplayUnitType.DUT_LITERS_PER_SECOND
	newValues.append(UnitUtils.ConvertFromInternalUnits(v,ProjectUnits))
	
#Assign your output to the OUT variable.
OUT = newValues
# ----------------------------------------
code_block_11 = CodeBlock { {123,456,123,123,456,456}; }
code_block_12 = CodeBlock { 123; }
allIndicesOf = List.AllIndicesOf(list=code_block_11, item=code_block_12)
getItemAtIndex = List.GetItemAtIndex(list=code_block_11, index=allIndicesOf)
code_block_13 = CodeBlock { {123,456,123,123,456,456}; }
code_block_14 = CodeBlock(a=code_block_13) { a==123; }
filterByBoolMask = List.FilterByBoolMask(list=code_block_13, mask=code_block_14)
select_model_elements = DSModelElementsSelection()  # 4 picked in the model
code_block_15 = CodeBlock { "Mark"; }
code_block_16 = CodeBlock { "Mark"; }
getParameterValueByName_2 = Element.GetParameterValueByName(element=select_model_elements, parameterName=code_block_16)
code_block_17 = CodeBlock(a=getParameterValueByName_2) { a=="123"; }
code_block_18 = CodeBlock { "456"; }
if_ = If(test=code_block_17, true=code_block_18, false=getParameterValueByName_2)
setParameterByName = Element.SetParameterByName(element=select_model_elements, parameterName=code_block_15, value=if_)
name = Element.Name(parameters)
code_block_19 = CodeBlock { 1; }
python_script_2 = Python(IN[0]=select_model_element_3, IN[1]=name, IN[2]=code_block_19)
# ---------- python_script_2.python (53 lines) ----------
import clr
clr.AddReference('ProtoGeometry')
from Autodesk.DesignScript.Geometry import *
clr.AddReference('RevitAPI')
from Autodesk.Revit.DB import *

clr.AddReference("RevitServices")
import RevitServices
from RevitServices.Persistence import DocumentManager
from RevitServices.Transactions import TransactionManager
doc = DocumentManager.Instance.CurrentDBDocument
#The inputs to this node will be stored as a list in the IN variables.

element = UnwrapElement(IN[0])
name = IN[1]
values = IN[2]

parameters = []
listout = []
newValues = []
PU = []
Display = []
US = UnitUtils.GetValidDisplayUnits()
removed = []

def checkParameter(param):
	for p in param:
		internal = p.Definition
		if internal.BuiltInParameter != BuiltInParameter.INVALID:
			return p
	return param[0]

for n in name:
	param = element.GetParameters(n)
	if len(param) == 0:
		parameters.append(None)
	else:
		p = checkParameter(param)
		parameters.append(p)
		listout.append(p.StorageType)
		listout.append(p.Definition)

for p in parameters:
	try:
		ProjectUnits = p.DisplayUnitType
		Names = str(p.Definition.Name) + "[" + str(p.StorageType) + "]"
		Display.append(Names)
		PU.append(ProjectUnits)
		newValues.append(UnitUtils.ConvertToInternalUnits(values,ProjectUnits))
	except:
		removed.append(p.Definition.Name)
#Assign your output to the OUT variable.
OUT = Display, PU, newValues, US, removed
# ----------------------------------------
code_block_20 = CodeBlock(a=python_script_2) { a[1]; }
code_block_21 = CodeBlock(a=python_script_2) { a[2]; }
code_block_22 = CodeBlock { {300}; }
code_block_23 = CodeBlock(a=python_script_2) { a[1][9]; }
convertToInternalUnits_2 = Python(IN[0]=code_block_22, IN[1]=code_block_23)
# ---------- convertToInternalUnits_2.python (26 lines) ----------
import clr
clr.AddReference('ProtoGeometry')
from Autodesk.DesignScript.Geometry import *
clr.AddReference('RevitAPI')
from Autodesk.Revit.DB import *

clr.AddReference("RevitServices")
import RevitServices
from RevitServices.Persistence import DocumentManager
from RevitServices.Transactions import TransactionManager
doc = DocumentManager.Instance.CurrentDBDocument
#The inputs to this node will be stored as a list in the IN variables.

values = IN[0]
PU = IN[1]

listout = []
newValues = []


for v in values:
	ProjectUnits = DisplayUnitType.DUT_LITERS_PER_SECOND
	newValues.append(UnitUtils.ConvertToInternalUnits(v,PU))
	
#Assign your output to the OUT variable.
OUT = newValues
# ----------------------------------------
code_block_24 = CodeBlock(a=python_script_2) { a[0]; }
code_block_25 = CodeBlock(a=python_script_2) { a[1]; }
ui_dropdown_data = Custom[UI.DropDown Data](Keys=code_block_24, Values=code_block_25)  # Create data for DropDown input in UI.MultiInputForm ++ . Check out www.data-shapes.net for more infos.
code_block_26 = CodeBlock { 0; }
ui_multipleinputform = Custom[UI.MultipleInputForm ++](Inputs=ui_dropdown_data, Toggle=code_block_26)  # Create a form with multiple inputs. see www.data-shapes.net for tutorials and infos!
unitType = Parameter.UnitType(parameters)
code_block_27 = CodeBlock { "UT_Number"; }
allIndicesOf_2 = List.AllIndicesOf(list=unitType, item=code_block_27)
removeItemAtIndex = List.RemoveItemAtIndex(list=unitType, indices=allIndicesOf_2)
removeItemAtIndex_2 = List.RemoveItemAtIndex(list=name, indices=allIndicesOf_2)
code_block_28 = CodeBlock(a=removeItemAtIndex_2) { Flatten({a[0..4],"Reynold number",a[5..Count(a)-1]}); }
code_block_29 = CodeBlock(a=python_script_2) { a[4]; }
code_block_30 = CodeBlock {  }
