# Dynamo graph VoidTags01.dyn (Dynamo 2.0.1.5055)

current = Document.Current()
activeView = Document.ActiveView(document=current)
python_script = Python()  # unwired: IN[0]
# ---------- python_script.python (42 lines) ----------
import clr

clr.AddReference("RevitAPIUI")
from Autodesk.Revit.UI import IExternalEventHandler, ExternalEvent, TaskDialog
from Autodesk.Revit.UI.Selection import *

clr.AddReference("RevitAPI")
from Autodesk.Revit.DB import Transaction, OverrideGraphicSettings, ElementId, Color
# noinspection PyUnresolvedReferences
from Autodesk.Revit.Exceptions import InvalidOperationException


clr.AddReference('RevitServices')
from RevitServices.Persistence import DocumentManager


global result



doc = DocumentManager.Instance.CurrentDBDocument
uidoc = DocumentManager.Instance.CurrentUIApplication.ActiveUIDocument


class CustomISelectionFilter(ISelectionFilter):
	def __init__(self, category_name):
		self.category_name = category_name
	def AllowElement(self, e):
		if e.Category.Name == self.category_name:
			return True
		else:
			return False
	def AllowReference(self, ref, point):
		return false

ref = uidoc.Selection.PickObjects(ObjectType.Element, CustomISelectionFilter("Structural Connections"), "Select Penetrations")

result = [doc.GetElement(r) for r in ref]

names = [r.Name for r in result]

OUT = result, names, set(names)
# ----------------------------------------
code_block = CodeBlock(a=python_script) { a[0]; }
name = Element.Name()  # unwired: element
groupByFunction = List.GroupByFunction(list=code_block, func=name)
code_block_2 = CodeBlock(a=groupByFunction) { a[0]; }
python_script_2 = Python(IN[0]=code_block_2)
# ---------- python_script_2.python (57 lines) ----------
import clr

clr.AddReference("RevitAPI")
from Autodesk.Revit.DB import *
# noinspection PyUnresolvedReferences
from Autodesk.Revit.Exceptions import InvalidOperationException

clr.AddReference('RevitServices')
from RevitServices.Persistence import DocumentManager

clr.AddReference("RevitNodes")
import Revit
# Import ToProtoType, ToRevitType geometry conversion extension methods
clr.ImportExtensions(Revit.GeometryConversion)

def GetParam(element, paramName):
	for p in element.Parameters:
		if p.Definition.Name == paramName:
			if p.StorageType == StorageType.String:
				return p.AsString()
			elif p.StorageType == StorageType.ElementId:
				elem = doc.GetElement(p.AsElementId())
				return elem
			elif p.StorageType == StorageType.Double:
				ProjectUnits = p.DisplayUnitType
				newval = UnitUtils.ConvertFromInternalUnits(p.AsDouble(),ProjectUnits)
				return newval
			else:
				return p.AsInteger()

def GetBeamWidth(element):
	opt = Options()
	opt.ComputeReferences = True
	opt.IncludeNonVisibleObjects = False
	opt.View = doc.ActiveView
	
	for instance in element.get_Geometry(opt):
		try:
			geomInst = instance.GetSymbolGeometry()
			instTransform = instance.Transform;
			width = (geomInst.GetBoundingBox().Max.Y - geomInst.GetBoundingBox().Min.Y)*304.8
		except:
			continue
	return width


doc = DocumentManager.Instance.CurrentDBDocument
uidoc = DocumentManager.Instance.CurrentUIApplication.ActiveUIDocument

penos = UnwrapElement(IN[0])

points = [p.Location.Point.ToPoint() for p in penos]
distance = [int(GetParam(p, "P_Distance from Start")) for p in penos]

host = [p.Host.Location.Curve.Direction.ToVector() for p in penos]

OUT = points, host, distance, [GetBeamWidth(p.Host) for p in penos]
# ----------------------------------------
code_block_3 = CodeBlock(a=python_script_2) { a[0]; a[1]; a[2]; a[3]; }
translate = Geometry.Translate(geometry=code_block_3.out0, direction=code_block_3.out1, distance=code_block_3.out2)
ZAxis = Vector.ZAxis()
cross = Vector.Cross(vector=code_block_3.out1, cross=ZAxis)
code_block_4 = CodeBlock { -500; }
translate_2 = Geometry.Translate(geometry=translate, direction=cross, distance=code_block_4)
byElementAndLocation = Tag.ByElementAndLocation(view=activeView, element=code_block_2, location=translate_2)
code_block_5 = CodeBlock { "Type"; }
code_block_6 = CodeBlock { ["2.094","2.298","2.484"]; }
code_block_7 = CodeBlock(a=python_script) { a[2]; }
code_block_8 = CodeBlock { ["Web_Peno_Tag","Web_Peno_Circular_Tag"]; }
byKeysValues = DesignScript.Builtin.Dictionary.ByKeysValues(keys=code_block_7, values=code_block_8)
code_block_9 = CodeBlock(a=python_script) { a[1]; }
valueAtKey = DesignScript.Builtin.Dictionary.ValueAtKey(dictionary=byKeysValues, key=code_block_9)
byName = Family.ByName(name=valueAtKey)
types = Family.Types(family=byName)
byKeysValues_2 = DesignScript.Builtin.Dictionary.ByKeysValues(keys=code_block_6, values=types)
python_script_3 = Python(IN[0]=code_block_2)
# ---------- python_script_3.python (29 lines) ----------
import clr

clr.AddReference("RevitAPIUI")
from Autodesk.Revit.UI import IExternalEventHandler, ExternalEvent, TaskDialog
from Autodesk.Revit.UI.Selection import *

clr.AddReference("RevitAPI")
from Autodesk.Revit.DB import Transaction, OverrideGraphicSettings, ElementId, Color
# noinspection PyUnresolvedReferences
from Autodesk.Revit.Exceptions import InvalidOperationException


clr.AddReference('RevitServices')
from RevitServices.Persistence import DocumentManager


clr.AddReference("RevitNodes")
import Revit
# Import ToProtoType, ToRevitType geometry conversion extension methods
clr.ImportExtensions(Revit.GeometryConversion)


doc = DocumentManager.Instance.CurrentDBDocument
uidoc = DocumentManager.Instance.CurrentUIApplication.ActiveUIDocument

beams = UnwrapElement(IN[0])
loc = [b.Location for b in beams]

OUT = [str(round(l.Rotation,3)) for l in loc]
# ----------------------------------------
valueAtKey_2 = DesignScript.Builtin.Dictionary.ValueAtKey(dictionary=byKeysValues_2, key=python_script_3)
setParameterByName = Element.SetParameterByName(element=byElementAndLocation, parameterName=code_block_5, value=valueAtKey_2)
code_block_10 = CodeBlock { "2.094"; }
allIndicesOf = List.AllIndicesOf(list=python_script_3, item=code_block_10)
getItemAtIndex = List.GetItemAtIndex(list=setParameterByName, index=allIndicesOf)
code_block_11 = CodeBlock { "Orientation"; }
code_block_12 = CodeBlock { 1; }
setParameterByName_2 = Element.SetParameterByName(element=getItemAtIndex, parameterName=code_block_11, value=code_block_12)
