# Dynamo graph WallByProfileWopening01.dyn (Dynamo 1.3.1.1736)

# group: DYNAMO WALL BY FACE + SAT FILE
code_block = CodeBlock { "WallCenterline"; }
wall_types = WallTypes("STR-Conc Insitu Wall Nwt - (300mm)")
geometry = Element.Geometry()  # unwired: arg0
code_block_2 = CodeBlock(a=geometry) { {a[0]}; }
byFace = Wall.ByFace(code_block, wall_types, code_block_2)
select_model_element = DSModelElementSelection()
code_block_3 = CodeBlock { 100; }

# group: DYNAMO WALL BY FACE + RHINO GEOMETRY
file_path = Filename("C:\Users\giovanni.brogiolo\Desktop\Test1.3dm")
code_block_4 = CodeBlock { "WallCenterline"; }
wall_types_2 = WallTypes("STR-Conc Insitu Wall Nwt - (300mm)")
get_RhinoFile = Interoperability.ReadRhino.OpenRhino3dmModel.Get_RhinoFile()  # unwired: arg0
get_RhinoObjects = Interoperability.ReadRhino.RhinoObject.Get_RhinoObjects(get_RhinoFile)
rhino_BrepsToDS = Interoperability.ReadRhino.RhinoTranslationToDS.Rhino_BrepsToDS(get_RhinoObjects)
code_block_5 = CodeBlock { 1000; }
scale = Geometry.Scale(geometry=rhino_BrepsToDS, xamount=code_block_5, yamount=code_block_5, zamount=code_block_5)
code_block_6 = CodeBlock(a=scale) { a[0]; }
byFace_2 = Wall.ByFace(code_block_4, wall_types_2, code_block_6)

# group: WOMBAT WALL BY PROFILE
file_path_2 = Filename("C:\Users\giovanni.brogiolo\Desktop\Test1.3dm")
get_RhinoFile_2 = Interoperability.ReadRhino.OpenRhino3dmModel.Get_RhinoFile(file_path_2)
get_RhinoObjects_2 = Interoperability.ReadRhino.RhinoObject.Get_RhinoObjects(get_RhinoFile_2)
rhino_BrepsToDS_2 = Interoperability.ReadRhino.RhinoTranslationToDS.Rhino_BrepsToDS(get_RhinoObjects_2)
code_block_7 = CodeBlock { 1; }
scale_2 = Geometry.Scale(geometry=rhino_BrepsToDS_2, xamount=code_block_7, yamount=code_block_7, zamount=code_block_7)
code_block_8 = CodeBlock { 0; }
wall_types_3 = WallTypes("STR-Conc Insitu Wall Nwt - (300mm)")
levels = Levels("00")
code_block_9 = CodeBlock { 0; }

perimeterCurves = Surface.PerimeterCurves(scale_2)
group_curves = Custom[Group Curves](Curves=perimeterCurves, lacing=Longest)  # This node will take any input of flat list of curves and group them into sublists containing "joinable" curves that is continous curves. They might form closed curves or open curves. Use PolyCurve.ByJoinedCurves to convert output groups of curves into single PolyCurves
byJoinedCurves = PolyCurve.ByJoinedCurves(group_curves)

# group (continued): WOMBAT WALL BY PROFILE
getItemAtIndex = List.GetItemAtIndex(list=byJoinedCurves, index=code_block_8, lacing=Longest)
explode = Geometry.Explode(getItemAtIndex)
byProfile = WombatDynamo.Wall.ByProfile(explode, wall_types_3, levels, code_block_9)

# group: Select the walls with openings
count = Count(byJoinedCurves, lacing=Longest)
code_block_10 = CodeBlock(a=count) { a>1; }
filterByBoolMask = List.FilterByBoolMask(list=byJoinedCurves, mask=code_block_10)

# group: Create a list of host walls
filterByBoolMask_2 = List.FilterByBoolMask(list=byProfile, mask=code_block_10)
code_block_11 = CodeBlock(a=count) { a-1; }
filterByBoolMask_3 = List.FilterByBoolMask(list=code_block_11, mask=code_block_10)
cycle = List.Cycle(list=filterByBoolMask_2.in, amount=filterByBoolMask_3.in, lacing=Longest)
flatten = Flatten(cycle)

family_types = FamilyTypes("Angled Step:Angled Step")

# group: Get the opening corner points
restOfItems = List.RestOfItems(filterByBoolMask.in, lacing=Longest)
explode_2 = Geometry.Explode(restOfItems)
endPoint = Curve.EndPoint(explode_2)

# group: Find the opening placement point (centroid of the opening)
python_script = Python(IN[0]=endPoint)
# ---------- python_script.python (19 lines) ----------
import clr
clr.AddReference('ProtoGeometry')
from Autodesk.DesignScript.Geometry import *
#The inputs to this node will be stored as a list in the IN variables.
pts = IN[0]

ptsOut = []

for i in range(0,len(pts)):
	pt = []
	ptsOut.append(pt)
	for j in range(0,len(pts[i])):
		subpt = []
		subpt.append(pts[i][j][0])
		subpt.append(pts[i][j][3])
		pt.append(subpt)

#Assign your output to the OUT variable.
OUT = ptsOut
# ----------------------------------------
code_block_12 = CodeBlock { 0; }
getItemAtIndex_2 = List.GetItemAtIndex(list=python_script@L2, index=code_block_12, lacing=Longest)
code_block_13 = CodeBlock { 1; }
getItemAtIndex_3 = List.GetItemAtIndex(list=python_script@L2, index=code_block_13, lacing=Longest)
byStartPointEndPoint = Line.ByStartPointEndPoint(startPoint=getItemAtIndex_2, endPoint=getItemAtIndex_3)
code_block_14 = CodeBlock { 0.5; }
pointAtParameter = Curve.PointAtParameter(curve=byStartPointEndPoint, param=code_block_14)

byPoints = Custom[Springs.HostedInstance.ByPoints](host=flatten, type=family_types, point=pointAtParameter, lacing=Longest)  # Creates hosted family instances(doors/windows) at the specified points. You can feed either a single family type or a unique type for each instance.
setParameterByName = Element.SetParameterByName(element=byPoints)  # unwired: parameterName, value
code_block_15 = CodeBlock { {"Rough Width","Rough Height"}; }

# group: Get Width and Height for each Opening
byCornerPoints = Rectangle.ByCornerPoints(endPoint)
flatten_2 = Flatten(byCornerPoints)
width = Rectangle.Width(flatten_2)
height = Rectangle.Height(flatten_2)
create = List.Create(width, height)

combine = List.Combine(setParameterByName, code_block_15, create)
