# Dynamo graph cableTrays.dyn (Dynamo 2.0.1.4955)

file_path = Filename("\\cadtools\cadtools\UKMEA BIM Team\Working Area\Global Revit Standards\02 Templates\01 Existing Arup Templates\CableTrays\CableTrays")
code_block = CodeBlock { "Sheet1"; }
code_block_2 = CodeBlock { 0; }
code_block_3 = CodeBlock { 0; }
python_script = Python()  # unwired: IN[0]
# ---------- python_script.python (28 lines) ----------
import clr

clr.AddReference('RevitAPI')
from Autodesk.Revit.DB import *
from Autodesk.Revit.DB.Structure import *

clr.AddReference('RevitAPIUI')
from Autodesk.Revit.UI import *

clr.AddReference('System')
from System.Collections.Generic import List

clr.AddReference('RevitNodes')
import Revit
clr.ImportExtensions(Revit.GeometryConversion)
clr.ImportExtensions(Revit.Elements)

clr.AddReference('RevitServices')
import RevitServices
from RevitServices.Persistence import DocumentManager
from RevitServices.Transactions import TransactionManager

doc = DocumentManager.Instance.CurrentDBDocument
uidoc=DocumentManager.Instance.CurrentUIApplication.ActiveUIDocument

ct = FilteredElementCollector(doc).OfCategory( BuiltInCategory.OST_CableTray )

OUT = [c.ToDSType(True).Name for c in ct]
# ----------------------------------------
exportExcel = Data.ExportExcel(filePath=file_path, sheetName=code_block, startRow=code_block_2, startCol=code_block_3, data=python_script)
