# Dynamo graph changeElementLocation.dyn (Dynamo 2.0.1.4955)

select_model_element = DSModelElementSelection()  # 1 picked in the model
code_block = CodeBlock(a=select_model_element) { [a]; }
select_model_element_2 = DSModelElementSelection()  # 1 picked in the model
code_block_2 = CodeBlock(a=select_model_element_2) { [a]; }
python_script = Python(IN[0]=code_block_2)
# ---------- python_script.python (28 lines) ----------
import clr
clr.AddReference('RevitAPI')
from Autodesk.Revit.DB import *

clr.AddReference("RevitNodes")
import Revit
clr.ImportExtensions(Revit.GeometryConversion)

clr.AddReference('ProtoGeometry')
from Autodesk.DesignScript.Geometry import *

items = UnwrapElement(IN[0])

lines = []

for item in items:
	lines.append(item.Location.Curve.ToProtoType())

Pts = []


for line in lines:
	pt = []
	pt.append(Curve.PointAtParameter(line,1))
	pt.append(Curve.PointAtParameter(line,0))
	Pts.append(pt)

OUT = Pts
# ----------------------------------------
python_script_2 = Python(IN[0]=code_block, IN[1]=python_script)
# ---------- python_script_2.python (42 lines) ----------
import clr

clr.AddReference("RevitServices")
import RevitServices
from RevitServices.Persistence import DocumentManager
from RevitServices.Transactions import TransactionManager
doc = DocumentManager.Instance.CurrentDBDocument

clr.AddReference("RevitAPI")
import Autodesk
from Autodesk.Revit.DB import *

clr.AddReference("RevitNodes")
import Revit
clr.ImportExtensions(Revit.Elements)
clr.ImportExtensions(Revit.GeometryConversion)

clr.AddReference("System")
from System.Collections.Generic import List

beamElements = UnwrapElement(IN[0])
pts = UnwrapElement(IN[1])

beamLocations = []

for beam in beamElements:
	beamLocations.append(beam.Location)

newBeamLine = []

TransactionManager.Instance.EnsureInTransaction(doc)

for i in range(0,len(beamLocations)):
	newBeamLine = Line.CreateBound(pts[i][0].ToXyz(), pts[i][1].ToXyz())
	#Change the beam location line to a new line:
	beamLocations[i].Curve = newBeamLine;

            

TransactionManager.Instance.TransactionTaskDone()

OUT = beamElements
# ----------------------------------------
select_model_element_3 = DSModelElementSelection()  # 1 picked in the model
curves = Element.Curves(element=select_model_element_3)
byCurve = ModelCurve.ByCurve(curve=curves)
