# Dynamo graph circuitsListPython.dyn (Dynamo 1.3.2.2480)

select_model_elements = DSModelElementsSelection()  # 1 picked in the model
python_script = Python(IN[0]=select_model_elements)
# ---------- python_script.python (51 lines) ----------
import clr
clr.AddReference('ProtoGeometry')
from Autodesk.DesignScript.Geometry import *

clr.AddReference('RevitServices')
import RevitServices
from RevitServices.Persistence import DocumentManager
from RevitServices.Transactions import TransactionManager
from System.Collections.Generic import *

clr.AddReference('RevitNodes')
import Revit
clr.ImportExtensions(Revit.Elements)

clr.AddReference('RevitAPI')
import Autodesk
from Autodesk.Revit.DB import *
from Autodesk.Revit.DB.Electrical import *
from Autodesk.Revit.DB import MEPSystem

clr.AddReference('DSCoreNodes')
import DSCore
from DSCore.List import *

import sys
pyt_path = r'C:\Program Files (x86)\IronPython 2.7\Lib'
sys.path.append(pyt_path)

# Import List ( ICollection(ElementId) = List[ElementId]() )
clr.AddReference("System")
from System.Collections.Generic import List 

#The inputs to this node will be stored as a list in the IN variables.
input = UnwrapElement(IN[0])

listElectComponents = []

electComponents = List[ElementId]()

for i in range(0, len(input)):
	electComponents.Add(input[i].Id)

doc = DocumentManager.Instance.CurrentDBDocument

TransactionManager.Instance.EnsureInTransaction(doc)

#newCircuits = doc.Create.NewElectricalSystem(electComponents, ElectricalSystemType.PowerCircuit)

TransactionManager.Instance.TransactionTaskDone()

OUT = electComponents
# ----------------------------------------
code_block = CodeBlock { Flatten("LV"+{1..3}); }
code_block_2 = CodeBlock { {Flatten("DB"+{1..2}),Flatten("DB"+{3..5}),Flatten("DB"+{6..7})}; }
python_script_2 = Python(IN[0]=code_block, IN[1]=code_block_2)
# ---------- python_script_2.python (19 lines) ----------
import clr
clr.AddReference('ProtoGeometry')
from Autodesk.DesignScript.Geometry import *
#The inputs to this node will be stored as a list in the IN variables.
lv = IN[0]
db = IN[1]

combinedList = []

for i in range(0,len(lv)):
	subList = []
	combinedList.append(subList)
	for j in range(0,len(db[i])):
		subList.append(lv[i])
		subList.append(db[i][j])
		

#Assign your output to the OUT variable.
OUT = combinedList
# ----------------------------------------
select_model_elements_2 = DSModelElementsSelection()
code_block_3 = CodeBlock(a=select_model_elements_2) { {a}; }
select_model_elements_3 = DSModelElementsSelection()  # 3 picked in the model
code_block_4 = CodeBlock(a=select_model_elements_3) { {a[0..1],a[2..4],a[5..6]}; }
python_script_3 = Python(IN[0]=select_model_elements, IN[1]=code_block_4)
# ---------- python_script_3.python (53 lines) ----------
import clr
clr.AddReference('ProtoGeometry')
from Autodesk.DesignScript.Geometry import *

clr.AddReference('RevitServices')
import RevitServices
from RevitServices.Persistence import DocumentManager
from RevitServices.Transactions import TransactionManager
from System.Collections.Generic import *

clr.AddReference('RevitNodes')
import Revit
clr.ImportExtensions(Revit.Elements)

clr.AddReference('RevitAPI')
import Autodesk
from Autodesk.Revit.DB import *
from Autodesk.Revit.DB.Electrical import *
from Autodesk.Revit.DB import MEPSystem

clr.AddReference('DSCoreNodes')
import DSCore
from DSCore.List import *

# Import List ( ICollection(ElementId) = List[ElementId]() )
clr.AddReference("System")
from System.Collections.Generic import List 

doc = DocumentManager.Instance.CurrentDBDocument


#The inputs to this node will be stored as a list in the IN variables.
lv = UnwrapElement(IN[0])
db = UnwrapElement(IN[1])

newCircuits = []


TransactionManager.Instance.EnsureInTransaction(doc)

for i in range(0,len(lv)):
	subList = []
	#newCircuits.append(subList)
	for j in range(0,len(db[i])):
		elements = List[ElementId]()
		elements = [lv[i], db[i][j]]
		newCircuits.append(elements)
		#newCircuits.append(doc.Create.NewElectricalSystem(elements, ElectricalSystemType.PowerCircuit))

TransactionManager.Instance.TransactionTaskDone()

#Assign your output to the OUT variable.
OUT = newCircuits
# ----------------------------------------
python_script_4 = Python(IN[0]=python_script_3)
# ---------- python_script_4.python (56 lines) ----------
import clr
clr.AddReference('ProtoGeometry')
from Autodesk.DesignScript.Geometry import *

clr.AddReference('RevitServices')
import RevitServices
from RevitServices.Persistence import DocumentManager
from RevitServices.Transactions import TransactionManager
from System.Collections.Generic import *

clr.AddReference('RevitNodes')
import Revit
clr.ImportExtensions(Revit.Elements)

clr.AddReference('RevitAPI')
import Autodesk
from Autodesk.Revit.DB import *
from Autodesk.Revit.DB.Electrical import *
from Autodesk.Revit.DB import MEPSystem

clr.AddReference('DSCoreNodes')
import DSCore
from DSCore.List import *

import sys
pyt_path = r'C:\Program Files (x86)\IronPython 2.7\Lib'
sys.path.append(pyt_path)

# Import List ( ICollection(ElementId) = List[ElementId]() )
clr.AddReference("System")
from System.Collections.Generic import List 

#The inputs to this node will be stored as a list in the IN variables.
input = UnwrapElement(IN[0])


doc = DocumentManager.Instance.CurrentDBDocument
uiapp = DocumentManager.Instance.CurrentUIApplication
app = uiapp.Application
uidoc = DocumentManager.Instance.CurrentUIApplication.ActiveUIDocument

TransactionManager.Instance.EnsureInTransaction(doc)

newCircuits = []

for e in input:
	ele = List[ElementId]()
	ele.Add(e[0].Id)
	ele.Add(e[1].Id)
#	newCircuits.append(doc.Create.NewElectricalSystem(ele, ElectricalSystemType.PowerCircuit))
	newCircuits.append(ele)


TransactionManager.Instance.TransactionTaskDone()

OUT = newCircuits
# ----------------------------------------
code_block_5 = CodeBlock(a=select_model_elements) { {a}; }
