# Dynamo graph closestGridPoint.dyn (Dynamo 1.3.2.2480)

code_block = CodeBlock { "a".."f"; }
code_block_2 = CodeBlock { 0..5; }
byCoordinates = Point.ByCoordinates(y=code_block_2)
code_block_3 = CodeBlock { 10; }
code_block_4 = CodeBlock { 0..5; }
byCoordinates_2 = Point.ByCoordinates(x=code_block_3, y=code_block_4)
byStartPointEndPoint = Line.ByStartPointEndPoint(startPoint=byCoordinates, endPoint=byCoordinates_2)
createDictionary = Lists.Dictionary.CreateDictionary(code_block, byStartPointEndPoint)
code_block_5 = CodeBlock { 0..3; }
string_from_object = FromObject(code_block_5)
add = string_from_object + code_block  # lacing=CrossProduct
flatten = Flatten(add)
code_block_6 = CodeBlock { Point.ByCoordinates(2.1,2.8); }
code_block_7 = CodeBlock { Point.ByCoordinates(3.1,2.8); }
code_block_8 = CodeBlock { 0..3; }
byCoordinates_3 = Point.ByCoordinates(x=code_block_8)
code_block_9 = CodeBlock { 0..3; }
code_block_10 = CodeBlock { 10; }
byCoordinates_4 = Point.ByCoordinates(x=code_block_9, y=code_block_10)
byStartPointEndPoint_2 = Line.ByStartPointEndPoint(startPoint=byCoordinates_3, endPoint=byCoordinates_4)
endPoints = Geometry.Curves.EndPoints(byStartPointEndPoint_2)
code_block_11 = CodeBlock(a=endPoints.out1) { a; }
YAxis = Vector.YAxis()
reverse = Vector.Reverse(YAxis)
project = Point.Project(code_block_11, byStartPointEndPoint, reverse, lacing=CrossProduct)
flatten_2 = Flatten(project@L4)
flatten_3 = Flatten(flatten_2)
python_script = Python(IN[0]=flatten_3, IN[1]=flatten)
# ---------- python_script.python (21 lines) ----------
import clr
clr.AddReference('ProtoGeometry')
from Autodesk.DesignScript.Geometry import *
#The inputs to this node will be stored as a list in the IN variables.
class GridPoint():
	def __init__(self):
		self.Point = None
		self.Name = None
		pass

list= []

for point,name in zip(IN[0],IN[1]):
	instance = GridPoint()
	instance.Point = point
	instance.Name = name
	list.append(instance)


#Assign your output to the OUT variable.
OUT = list
# ----------------------------------------
python_script_2 = Python(IN[0]=python_script)
# ---------- python_script_2.python (12 lines) ----------
import clr
clr.AddReference('ProtoGeometry')
from Autodesk.DesignScript.Geometry import *
#The inputs to this node will be stored as a list in the IN variables.

list = []

for l in IN[0]:
	subout = l.Point
	list.append(subout)
	
OUT = list
# ----------------------------------------
join = List.Join(byStartPointEndPoint_2, byStartPointEndPoint)
join_2 = List.Join(code_block_5, code_block)
code_block_12 = CodeBlock { 0.5; }

# group: FInd closest grid
byStartPointEndPoint_3 = Line.ByStartPointEndPoint(startPoint=code_block_6, endPoint=code_block_7)
python_script_3 = Python(IN[0]=join, IN[1]=join_2)
# ---------- python_script_3.python (21 lines) ----------
import clr
clr.AddReference('ProtoGeometry')
from Autodesk.DesignScript.Geometry import *
#The inputs to this node will be stored as a list in the IN variables.
class Grid():
	def __init__(self):
		self.Line = None
		self.Name = None
		pass

list= []

for line,name in zip(IN[0],IN[1]):
	instance = Grid()
	instance.Line = line
	instance.Name = name
	list.append(instance)


#Assign your output to the OUT variable.
OUT = list
# ----------------------------------------
pointAtParameter = Curve.PointAtParameter(curve=byStartPointEndPoint_3, param=code_block_12)
python_script_4 = Python(IN[0]=python_script_3)
# ---------- python_script_4.python (12 lines) ----------
import clr
clr.AddReference('ProtoGeometry')
from Autodesk.DesignScript.Geometry import *
#The inputs to this node will be stored as a list in the IN variables.

list = []

for l in IN[0]:
	subout = l.Line
	list.append(subout)
	
OUT = list
# ----------------------------------------
distanceTo = Geometry.DistanceTo(geometry=pointAtParameter, other=python_script_4)

endPoints_2 = Geometry.Curves.EndPoints(byStartPointEndPoint_3)
code_block_13 = CodeBlock(a=endPoints_2.out0, b=endPoints_2.out1) { {a,b}; }
distanceTo_2 = Geometry.DistanceTo(geometry=code_block_13, other=python_script_2, lacing=CrossProduct)
minimumItem = List.MinimumItem(distanceTo_2)
allIndicesOf = List.AllIndicesOf(list=distanceTo_2, item=minimumItem, lacing=Longest)
getItemAtIndex = List.GetItemAtIndex(list=flatten, index=allIndicesOf)

# group: distance from grid
minimumItem_2 = List.MinimumItem(distanceTo)

# group (continued): FInd closest grid
allIndicesOf_2 = List.AllIndicesOf(list=distanceTo, item=minimumItem_2)
getItemAtIndex_2 = List.GetItemAtIndex(list=python_script_3, index=allIndicesOf_2)

# group: grid name
python_script_5 = Python(IN[0]=getItemAtIndex_2)
# ---------- python_script_5.python (12 lines) ----------
import clr
clr.AddReference('ProtoGeometry')
from Autodesk.DesignScript.Geometry import *
#The inputs to this node will be stored as a list in the IN variables.

list = []

for l in IN[0]:
	subout = l.Name
	list.append(subout)
	
OUT = list
# ----------------------------------------
