# Dynamo graph combinator.dyn (Dynamo 1.3.2.2480)

python_script = Python()  # unwired: IN[0]
# ---------- python_script.python (17 lines) ----------
import clr
clr.AddReference('ProtoGeometry')
from Autodesk.DesignScript.Geometry import *
#The inputs to this node will be stored as a list in the IN variables.


items = ["v0", "v1", "v2", "v3"]
outer = []
for i in range(len(items)): 
	for j in range(i+1, len(items)):
		outer.append([items[i],items[j]])
		
		
#Assign your output to the OUT variable.
#OUT = [(items[i],items[j]) for i in range(len(items)) for j in range(i+1, len(items))]

OUT = outer
# ----------------------------------------
