# Dynamo graph createLineStyles01.dyn (Dynamo 2.0.1.4955)

# group: read data from excel
file_path = Filename("..\Downloads\lineStyleTamplate.xlsx")
file_from_path = FileObject(path=file_path)
code_block = CodeBlock { "Sheet1"; }
importExcel = Data.ImportExcel(file=file_from_path, sheetName=code_block)

deconstruct = List.Deconstruct(list=importExcel)
transpose = List.Transpose(lists=deconstruct.rest)
code_block_2 = CodeBlock(Names=transpose) { Names[0]; }
code_block_3 = CodeBlock(Weight=transpose) { Weight[2]; }

# group: Get pattern from Revit
python_script = Python()  # unwired: IN[0]
# ---------- python_script.python (40 lines) ----------
import clr

clr.AddReference('RevitAPI')
from Autodesk.Revit.DB import *
from Autodesk.Revit.DB.Structure import *

clr.AddReference('RevitAPIUI')
from Autodesk.Revit.UI import *

clr.AddReference('System')
from System.Collections.Generic import List

clr.AddReference('RevitNodes')
import Revit
clr.ImportExtensions(Revit.GeometryConversion)
clr.ImportExtensions(Revit.Elements)

clr.AddReference('RevitServices')
import RevitServices
from RevitServices.Persistence import DocumentManager
from RevitServices.Transactions import TransactionManager

doc = DocumentManager.Instance.CurrentDBDocument
uidoc=DocumentManager.Instance.CurrentUIApplication.ActiveUIDocument

#Preparing input from dynamo to revit
element = UnwrapElement(IN[0])

#Do some action in a Transaction
TransactionManager.Instance.EnsureInTransaction(doc)

TransactionManager.Instance.TransactionTaskDone()

fec = FilteredElementCollector( doc ).OfClass(LinePatternElement )

categories = doc.Settings.Categories;

lineCat = categories.get_Item(BuiltInCategory.OST_Lines );
    
OUT = [f for f in fec], [f.Name for f in fec], lineCat.SubCategories, [l.Name for l in lineCat.SubCategories]
# ----------------------------------------
code_block_4 = CodeBlock(a=python_script) { a[0]; }
code_block_5 = CodeBlock(a=python_script) { DSCore.List.Flatten([a[1],"Solid"]); }

# group: Select pattern
code_block_6 = CodeBlock(Patterns=transpose) { Patterns[3]; }
allIndicesOf = List.AllIndicesOf(list=code_block_5, item=code_block_6)
getItemAtIndex = List.GetItemAtIndex(list=code_block_4, index=allIndicesOf)

flatten = List.Flatten(list=getItemAtIndex)

# group: Read Colour
code_block_7 = CodeBlock(a=transpose) { a[4]; }
code_block_8 = CodeBlock { ","; }
split = String.Split(str=code_block_7, separater0=code_block_8)

python_script_2 = Python(IN[0]=code_block_2, IN[1]=code_block_3, IN[2]=flatten, IN[3]=split)
# ---------- python_script_2.python (56 lines) ----------
import clr

clr.AddReference('RevitAPI')
from Autodesk.Revit.DB import *
from Autodesk.Revit.DB.Structure import *

clr.AddReference('RevitAPIUI')
from Autodesk.Revit.UI import *

clr.AddReference('System')
from System.Collections.Generic import List

clr.AddReference('RevitNodes')
import Revit
clr.ImportExtensions(Revit.GeometryConversion)
clr.ImportExtensions(Revit.Elements)

clr.AddReference('RevitServices')
import RevitServices
from RevitServices.Persistence import DocumentManager
from RevitServices.Transactions import TransactionManager

doc = DocumentManager.Instance.CurrentDBDocument
uidoc=DocumentManager.Instance.CurrentUIApplication.ActiveUIDocument

#Preparing input from dynamo to revit
names = IN[0]
weights = IN[1]
patterns = UnwrapElement(IN[2])
colors = IN[3]

fec = FilteredElementCollector( doc ).OfClass(LinePatternElement )

categories = doc.Settings.Categories;

lineCat = categories.get_Item(BuiltInCategory.OST_Lines );

solidPattern =  ElementId(-3000010)

#Do some action in a Transaction
TransactionManager.Instance.EnsureInTransaction(doc)

for n,w,p,c in zip(names,weights,patterns,colors):
	newLineStyleCat = categories.NewSubcategory( lineCat, n );
	newLineStyleCat.SetLineWeight(w, GraphicsStyleType.Projection )
	try:
		newLineStyleCat.SetLinePatternId(p.Id, GraphicsStyleType.Projection)
	except:
		newLineStyleCat.SetLinePatternId(solidPattern, GraphicsStyleType.Projection)	
	newLineStyleCat.LineColor = Color(int(c[0]),int(c[1]),int(c[2]))

doc.Regenerate();

TransactionManager.Instance.TransactionTaskDone()

OUT = newLineStyleCat
# ----------------------------------------

# group: bimorph
code_block_9 = CodeBlock { 1; }
allAttributes = Revit.LineStyle.AllAttributes(refresh=code_block_9)
watch = Watch(allAttributes.name)
create = Revit.LineStyle.Create()  # unwired: name, weight, color
