# Dynamo graph createObject.dyn (Dynamo 1.3.2.2480)

python_script = Python()  # frozen; unwired: IN[0], IN[1]
# ---------- python_script.python (35 lines) ----------
import clr
clr.AddReference('ProtoGeometry')
from Autodesk.DesignScript.Geometry import *
#The inputs to this node will be stored as a list in the IN variables.
dataEnteringNode = IN

class Obj:

	def __init__(self, Element, Level):
		self.Element = Element
		self.Level = Level
		pass

	def printOut(self):
		return [self.Element, self.Level]
		pass
		
	def __getitem__(self, item):
		return getattr(self, item)
		pass

eList = []

for e,l in zip(IN[0], IN[1]):
	instance = Obj (e, l)
	eList.append(instance)

sortedList = []

for m in eList:
	sort = sorted(m, key=lambda instance: instance["Level"])
	sortedList.append(sort)


OUT = sortedList
# ----------------------------------------
select_model_elements = DSModelElementsSelection()  # 21 picked in the model
code_block = CodeBlock { "Base Constraint"; }
getParameterValueByName = Element.GetParameterValueByName(element=select_model_elements, parameterName=code_block)
elevation = Level.Elevation(getParameterValueByName)
string_from_object = FromObject(elevation)
code_block_2 = CodeBlock()
# ---------- code_block_2.designscript (22 lines) ----------
{"S50",
"S50",
"S50",
"S50",
"S50",
"S50",
"S50",
"S50",
"S50",
"S50",
"S50",
"S50",
"S50",
"S40",
"S40",
"S40",
"S40",
"S40",
"S40",
"S40",
"S40"
};
# ----------------------------------------
elevation_2 = Level.Elevation()  # unwired: arg0
sortByFunction = SortByFunction(getParameterValueByName, elevation_2)
allIndicesOf = List.AllIndicesOf(list=getParameterValueByName, item=sortByFunction)
getItemAtIndex = List.GetItemAtIndex(list=select_model_elements, index=allIndicesOf)
code_block_3 = CodeBlock { "Wall Concrete Grade"; }
code_block_4 = CodeBlock()
# ---------- code_block_4.designscript (21 lines) ----------
{"350",
"350",
"350",
"350",
"350",
"350",
"350",
"350",
"350",
"350",
"350",
"350",
"350",
"350",
"350",
"350",
"350",
"350",
"300",
"300",
"300"};
# ----------------------------------------
setParameterByName = Element.SetParameterByName(element=getItemAtIndex, parameterName=code_block_3, value=code_block_4)
