# Dynamo graph createObjectAsDictionary.dyn (Dynamo 1.3.2.2480)

code_block = CodeBlock { "a".."e"; }
code_block_2 = CodeBlock { {0,3,2,4,1}; }
python_script = Python(IN[0]=code_block, IN[1]=code_block_2)
# ---------- python_script.python (34 lines) ----------
import clr
clr.AddReference('ProtoGeometry')
from Autodesk.DesignScript.Geometry import *
#The inputs to this node will be stored as a list in the IN variables.
dataEnteringNode = IN

class Obj:

	def __init__(self, Element, Level):
		self.Element = Element
		self.Level = Level
		pass

	def printOut(self):
		return [self.Element, self.Level]
		pass
		
	def __getitem__(self, item):
		return getattr(self, item)
		pass

eList = []

for e,l in zip(IN[0], IN[1]):
	instance = Obj (e, l)
	eList.append(instance)


sortedList = sorted(eList, key=lambda instance: instance["Level"])


#newlist = sorted(eList, key=lambda x: x.Level, reverse=True)

OUT = eList, sortedList
# ----------------------------------------
deconstruct = List.Deconstruct(list=python_script)
code_block_3 = CodeBlock(a=deconstruct.rest) { a[0]; }
python_script_2 = Python(IN[0]=code_block_3)
# ---------- python_script_2.python (10 lines) ----------
import clr
clr.AddReference('ProtoGeometry')
from Autodesk.DesignScript.Geometry import *
#The inputs to this node will be stored as a list in the IN variables.
dEN = IN[0]



#Assign your output to the OUT variable.
OUT = [d.printOut() for d in dEN]
# ----------------------------------------
