# Dynamo graph curveLength.dyn (Dynamo 2.0.1.5055)

select_model_elements = DSModelElementsSelection()  # 1 picked in the model
geometry = Element.Geometry(element=select_model_elements)
code_block = CodeBlock(a=geometry) { a[1]; }
length = Curve.Length(curve=code_block)
code_block_2 = CodeBlock { 5000; }
code_block_3 = CodeBlock(a=length, b=code_block_2) { Math.Floor(a/b); }
sequence = Sequence(amount=code_block_3, step=code_block_2)

# group: Segment Length -> Working if curve is Nurbs
parameterAtSegmentLength = Curve.ParameterAtSegmentLength(curve=code_block, segmentLength=sequence)
flatten = List.Flatten(list=parameterAtSegmentLength)
restOfItems = List.RestOfItems(list=flatten)
segmentLengthBetweenParameters = Curve.SegmentLengthBetweenParameters(curve=code_block, startParam=flatten, endParam=restOfItems, lacing=Longest)

# group: Chord Length -> Not working
parameterAtChordLength = Curve.ParameterAtChordLength(curve=code_block, chordLength=sequence)
flatten_2 = List.Flatten(list=parameterAtChordLength)
restOfItems_2 = List.RestOfItems(list=flatten_2)
segmentLengthBetweenParameters_2 = Curve.SegmentLengthBetweenParameters(curve=code_block, startParam=flatten_2, endParam=restOfItems_2, lacing=Longest)

coordinateSystemAtParameter = Curve.CoordinateSystemAtParameter()  # unwired: curve
horizontalFrameAtParameter = Curve.HorizontalFrameAtParameter(curve=code_block, param=parameterAtSegmentLength)
origin = CoordinateSystem.Origin(coordinateSystem=horizontalFrameAtParameter)
YAxis = CoordinateSystem.YAxis(coordinateSystem=horizontalFrameAtParameter)
code_block_4 = CodeBlock { 10000; }
byStartPointDirectionLength = Line.ByStartPointDirectionLength(startPoint=origin, direction=YAxis, length=code_block_4, lacing=Longest)
code_block_5 = CodeBlock(a=code_block_4) { -a/2; }
translate = Geometry.Translate(geometry=byStartPointDirectionLength, direction=YAxis, distance=code_block_5)
byCurve = ModelCurve.ByCurve(curve=translate)
byJoinedCurves = PolyCurve.ByJoinedCurves(curves=geometry)
toNurbsCurve = Curve.ToNurbsCurve(curve=byJoinedCurves)
