# Dynamo graph dateTime.dyn (Dynamo 1.3.3.4651)

python_script = Python()  # frozen; unwired: IN[0]
# ---------- python_script.python (9 lines) ----------
import clr

import datetime




#Assign your output to the OUT variable.
OUT = datetime.datetime.now()
# ----------------------------------------
