# Dynamo graph deleteElements02.dyn (Dynamo 2.0.1.4955)

select_model_elements = DSModelElementsSelection()  # 1 picked in the model
code_block = CodeBlock(a=select_model_elements) { [a]; }
python_script = Python(IN[0]=code_block)
# ---------- python_script.python (49 lines) ----------
#Copyright(c) 2016, Dimitar Venkov
# @5devene, dimitar.ven@gmail.com

import clr
import math

clr.AddReference("RevitServices")
import RevitServices
from RevitServices.Persistence import DocumentManager
from RevitServices.Transactions import TransactionManager
doc = DocumentManager.Instance.CurrentDBDocument

clr.AddReference("RevitNodes")
import Revit
clr.ImportExtensions(Revit.Elements)
clr.ImportExtensions(Revit.GeometryConversion)

clr.AddReference("RevitAPI")
from Autodesk.Revit.DB import *

elements = UnwrapElement(IN[0])

TransactionManager.Instance.EnsureInTransaction(doc)

t1 = SubTransaction(doc)
t1.Start()
deleted = []
for e in elements:
	deleted.append(doc.Delete(e.Id))
t1.RollBack()


TransactionManager.Instance.TransactionTaskDone()

allElements = []
extrusion = []

for items in deleted:
	for d in items:
		test_el = doc.GetElement(d)
		allElements.append(test_el)
		el_type = test_el.GetType().ToString()
	#if el_type == "Autodesk.Revit.DB.ModelLine":
		extrusion.append(test_el)

				
				
	
OUT = extrusion
# ----------------------------------------
parameters = Element.Parameters(element=python_script)
