# Dynamo graph detailCurve.dyn (Dynamo 1.3.1.1736)

get_revit_activeview = Custom[Get Revit ActiveView]()  # Active View
select_model_element = DSModelElementSelection()  # 1 picked in the model
curves = Element.Curves(select_model_element)
endPoint = Curve.EndPoint(curves)
code_block = CodeBlock { 25; }
byCenterPointRadius = Circle.ByCenterPointRadius(centerPoint=endPoint, radius=code_block)
byCurve = DetailCurve.ByCurve(get_revit_activeview, byCenterPointRadius)

# group: Hot Gear
get_revit_activeview_2 = Custom[Get Revit ActiveView]()

# group: Clockwork
fromCurve = Custom[DetailLine.FromCurve](curve=byCenterPointRadius, view=get_revit_activeview_2)  # Creates a detail line based on a given curve

select_model_element_2 = DSModelElementSelection()  # 1 picked in the model
curves_2 = Element.Curves(select_model_element_2)
family_types = FamilyTypes("AP_Rebar in Section-Range:Ø16")
levels = Levels("00")

# group: Clockwork
byCurve_2 = Custom[FamilyInstance.ByCurve](curve=curves_2, familyType=family_types, level=levels)  # Places a line-based family instance on a given level

code_block_2 = CodeBlock { "Centers"; }
code_block_3 = CodeBlock { 300; }
setParameterByName = Element.SetParameterByName(element=byCurve_2, parameterName=code_block_2, value=code_block_3)
