# Dynamo graph docDelete.dyn (Dynamo 2.1.0.6255)

python_script = Python()  # unwired: IN[0]
# ---------- python_script.python (39 lines) ----------
import clr

clr.AddReference("RevitServices")
import RevitServices
from RevitServices.Persistence import DocumentManager
from RevitServices.Transactions import TransactionManager
clr.AddReference("RevitAPI")
import Autodesk
from Autodesk.Revit.DB import FilteredElementCollector

doc = DocumentManager.Instance.CurrentDBDocument

view  = doc.ActiveView

collector = FilteredElementCollector( doc, view.Id ).WhereElementIsNotElementType()

elems = []

for c in collector:
	#if c.Category.Name == "Walls":
	if c.Category.HasMaterialQuantities == True:
		elems.append(c)

TransactionManager.Instance.EnsureInTransaction(doc)

result = []	

for e in elems:
	eid = e.Id
	try:
		del_id = doc.Delete(eid)
		result.append(str(eid)+" deleted")
	except:
		result.append(str(eid)+" failed")

TransactionManager.Instance.TransactionTaskDone()


OUT = result
# ----------------------------------------
