# Dynamo graph documentPBSP.dyn (Dynamo 1.3.3.4651)

file_path = Filename("\\global.arup.com\australasia\MEL\Projects\261000\261184-00 Shipwreck Coast Master\Work\Internal\BIM_CDE\01_WORKING\10_STR\00_MODEL\261184-ARP-M3-S_R18-ASL.rvt")
file_path_2 = Filename("\\global.arup.com\australasia\MEL\Projects\261000\261184-00 Shipwreck Coast Master\Work\Internal\BIM_CDE\01_WORKING\10_STR\00_MODEL\261184-ARP-M3-S_R18-LAB.rvt")
create = List.Create(file_path, file_path_2)

# group: from Rhythm package
openDocumentFile = Rhythm.Revit.Application.Application.OpenDocumentFile()  # unwired: arg0

# group: base points
python_script = Python(IN[0]=openDocumentFile)
# ---------- python_script.python (37 lines) ----------
#Copyright(c) 2017, john pierson
# @60secondrevit, http://sixtysecondrevit.com
import clr
clr.AddReference('ProtoGeometry')
from Autodesk.DesignScript.Geometry import *

# Import Element wrapper extension methods
clr.AddReference("RevitNodes")
import Revit
clr.ImportExtensions(Revit.Elements)

# Import geometry conversion extension methods
clr.ImportExtensions(Revit.GeometryConversion)

# Import DocumentManager and TransactionManager
clr.AddReference("RevitServices")
import RevitServices
from RevitServices.Persistence import DocumentManager
from RevitServices.Transactions import TransactionManager

doc = DocumentManager.Instance.CurrentDBDocument
uiapp = DocumentManager.Instance.CurrentUIApplication
app = uiapp.Application

# Import RevitAPI
clr.AddReference("RevitAPI")
import Autodesk
from Autodesk.Revit.DB import *

doc = IN[0]

collector = []

for d in doc:
	collector.append(FilteredElementCollector(d).OfCategory(BuiltInCategory.OST_ProjectBasePoint).ToElements()[0])
		
OUT = collector
# ----------------------------------------

parameters = Element.Parameters(python_script)
code_block = CodeBlock { {"E/W","N/S", "Angle to True North"}; }
getParameterValueByName = Element.GetParameterValueByName(element=python_script, parameterName=code_block, lacing=CrossProduct)

# group: survey points
python_script_2 = Python(IN[0]=openDocumentFile)
# ---------- python_script_2.python (37 lines) ----------
#Copyright(c) 2017, john pierson
# @60secondrevit, http://sixtysecondrevit.com
import clr
clr.AddReference('ProtoGeometry')
from Autodesk.DesignScript.Geometry import *

# Import Element wrapper extension methods
clr.AddReference("RevitNodes")
import Revit
clr.ImportExtensions(Revit.Elements)

# Import geometry conversion extension methods
clr.ImportExtensions(Revit.GeometryConversion)

# Import DocumentManager and TransactionManager
clr.AddReference("RevitServices")
import RevitServices
from RevitServices.Persistence import DocumentManager
from RevitServices.Transactions import TransactionManager

doc = DocumentManager.Instance.CurrentDBDocument
uiapp = DocumentManager.Instance.CurrentUIApplication
app = uiapp.Application

# Import RevitAPI
clr.AddReference("RevitAPI")
import Autodesk
from Autodesk.Revit.DB import *

doc = IN[0]

collector = []

for d in doc:
	collector.append(FilteredElementCollector(d).OfCategory(BuiltInCategory.OST_SharedBasePoint).ToElements()[0])
		
OUT = collector
# ----------------------------------------

getParameterValueByName_2 = Element.GetParameterValueByName(element=python_script_2, parameterName=code_block, lacing=CrossProduct)
parameters_2 = Element.Parameters(python_script_2)
close = Custom[Document.Close](Document=openDocumentFile)  # Close current Revit document. Use boolean switch (true / false) to save / discard any changes.
open = Custom[Document.Open]()  # Open document from the input File Path; unwired: FilePath
