# Dynamo graph documentPBSP2.dyn (Dynamo 1.3.3.4651)

element_types = ElementTypes("BasePoint")
all_elements_of_type = ElementsOfType(element_types)
code_block = CodeBlock { {"E/W","N/S", "Angle to True North"}; }
python_script = Python(IN[0]=all_elements_of_type, IN[1]=code_block)
# ---------- python_script.python (42 lines) ----------
import clr
clr.AddReference('ProtoGeometry')
from Autodesk.DesignScript.Geometry import *

# Import DocumentManager and TransactionManager
clr.AddReference("RevitServices")
import RevitServices
from RevitServices.Persistence import DocumentManager
from RevitServices.Transactions import TransactionManager

# Import RevitAPI
clr.AddReference("RevitAPI")
import Autodesk
from Autodesk.Revit.DB import *

ele = UnwrapElement(IN[0])

name = IN[1]

def GetParam(element, paramName):
	value = []
	for p in element.Parameters:
		if p.Definition.Name == paramName:
			ProjectUnits = p.DisplayUnitType
			newVal = UnitUtils.ConvertFromInternalUnits(p.AsDouble(),ProjectUnits)
			value.append(newVal)
	return value

result = []

for e in ele:
	sub = []
	result.append(sub)
	for n in name:
		if GetParam(e,n):
			sub.append(GetParam(e,n)[0])
		else:
			sub.append("N/A")



OUT = result
# ----------------------------------------
code_block_2 = CodeBlock { "N/S"; }
getParameterValueByName = Element.GetParameterValueByName(element=all_elements_of_type, parameterName=code_block_2)
type = Object.Type(getParameterValueByName, lacing=Longest)
parameters = Element.Parameters(all_elements_of_type)
