# Dynamo graph ductTypesRouting.dyn (Dynamo 2.0.1.4955)

file_path = Filename("\\cadtools\cadtools\UKMEA BIM Team\Working Area\Global Revit Standards\02 Templates\01 Existing Arup Templates\CableTrays\ductRouting")
code_block = CodeBlock { "Sheet1"; }
code_block_2 = CodeBlock { 0; }
code_block_3 = CodeBlock()
# ---------- code_block_3.designscript (8 lines) ----------
["Pipe Type","Segment",
"Elbow",
"Junction",
"Cross",
"Transition",
"Union",
"Flanges",
"Cap","Preferred Junction Type"];
# ----------------------------------------
python_script = Python()  # unwired: IN[0]
# ---------- python_script.python (183 lines) ----------
import clr

clr.AddReference('RevitAPI')
from Autodesk.Revit.DB import *
from Autodesk.Revit.DB.Structure import *
from Autodesk.Revit.DB.Mechanical import *

clr.AddReference('RevitAPIUI')
from Autodesk.Revit.UI import *

clr.AddReference('System')
from System.Collections.Generic import List

clr.AddReference('RevitNodes')
import Revit
clr.ImportExtensions(Revit.GeometryConversion)
clr.ImportExtensions(Revit.Elements)

clr.AddReference('RevitServices')
import RevitServices
from RevitServices.Persistence import DocumentManager
from RevitServices.Transactions import TransactionManager

doc = DocumentManager.Instance.CurrentDBDocument
#uidoc=DocumentManager.Instance.CurrentUIApplication.ActiveUIDocument

#doc = UnwrapElement(IN[0])

types = FilteredElementCollector(doc).OfClass(DuctType)

#typesItems = [t for t in types]
pipeSegmentNames = []
pipeElbowNames = []
pipeJunctionNames = []
pipeCrossNames = []
pipeTransitionNames = []
pipeUnionNames = []
mjNames = []
pipeCapNames = []
prefJunction = []

errors = []

for t in types:
	rpm = t.RoutingPreferenceManager
	nRules = rpm.GetNumberOfRules(RoutingPreferenceRuleGroupType.Segments)
	if nRules>0:
		subList = []
		pipeSegmentNames.append(subList)
		for i in range(0,nRules):
			pipeSegment = rpm.GetRule(RoutingPreferenceRuleGroupType.Segments,i)
			pipeSegmentId = pipeSegment.MEPPartId
			pipeSegmentElement = doc.GetElement(pipeSegmentId)
			subList.append(pipeSegmentElement.Name)
	else:
		pipeSegmentNames.append(["Empty"])
	
for t in types:
	rpm = t.RoutingPreferenceManager
	nRules = rpm.GetNumberOfRules(RoutingPreferenceRuleGroupType.Elbows)
	if nRules>0:
		subList = []
		pipeElbowNames.append(subList)
		for i in range(0,nRules):
			pipeElbow = rpm.GetRule(RoutingPreferenceRuleGroupType.Elbows,i)
			pipeElbowId = pipeElbow.MEPPartId
			pipeElbowElement = doc.GetElement(pipeElbowId)
			try:
				subList.append(pipeElbowElement.FamilyName + ":" + pipeElbowElement.ToDSType(True).Name)
			except:
				subList.append("empty")
	else:
		pipeElbowNames.append(["Empty"])

	
for t in types:
	rpm = t.RoutingPreferenceManager
	nRules = rpm.GetNumberOfRules(RoutingPreferenceRuleGroupType.Junctions)
	if nRules>0:
		subList = []
		pipeJunctionNames.append(subList)
		for i in range(0,nRules):
			pipeJunction = rpm.GetRule(RoutingPreferenceRuleGroupType.Junctions,i)
			pipeJunctionId = pipeJunction.MEPPartId
			pipeJunctionElement = doc.GetElement(pipeJunctionId)
			try:
				subList.append(pipeJunctionElement.FamilyName + ":" + pipeJunctionElement.ToDSType(True).Name)
			except:
				subList.append("empty")
	else:
		pipeJunctionNames.append(["Empty"])

for t in types:
	rpm = t.RoutingPreferenceManager
	nRules = rpm.GetNumberOfRules(RoutingPreferenceRuleGroupType.Crosses)
	if nRules>0:
		subList = []
		pipeCrossNames.append(subList)
		for i in range(0,nRules):
			pipeCross = rpm.GetRule(RoutingPreferenceRuleGroupType.Crosses,i)
			pipeCrossId = pipeCross.MEPPartId
			pipeCrossElement = doc.GetElement(pipeCrossId)
			try:
				subList.append(pipeCrossElement.FamilyName + ":" + pipeCrossElement.ToDSType(True).Name)
			except:
				subList.append("empty")
	else:
		pipeCrossNames.append(["Empty"])

for t in types:
	rpm = t.RoutingPreferenceManager
	nRules = rpm.GetNumberOfRules(RoutingPreferenceRuleGroupType.Transitions)
	if nRules>0:
		subList = []
		pipeTransitionNames.append(subList)
		for i in range(0,nRules):
			pipeTransition = rpm.GetRule(RoutingPreferenceRuleGroupType.Transitions,i)
			pipeTransitionId = pipeTransition.MEPPartId
			pipeTransitionElement = doc.GetElement(pipeTransitionId)
			subList.append(pipeTransitionElement.FamilyName + ":" + pipeTransitionElement.ToDSType(True).Name)
	else:
		pipeTransitionNames.append(["Empty"])

for t in types:
	rpm = t.RoutingPreferenceManager
	nRules = rpm.GetNumberOfRules(RoutingPreferenceRuleGroupType.Unions)
	if nRules>0:
		subList = []
		pipeUnionNames.append(subList)
		for i in range(0,nRules):
			pipeUnion = rpm.GetRule(RoutingPreferenceRuleGroupType.Unions,i)
			pipeUnionId = pipeUnion.MEPPartId
			pipeUnionElement = doc.GetElement(pipeUnionId)
			subList.append(pipeUnionElement.FamilyName + ":" + pipeUnionElement.ToDSType(True).Name)
	else:
		pipeUnionNames.append(["Empty"])

for t in types:
	rpm = t.RoutingPreferenceManager
	nRules = rpm.GetNumberOfRules(RoutingPreferenceRuleGroupType.MechanicalJoints)
	if nRules>0:
		subList = []
		mjNames.append(subList)
		for i in range(0,nRules):
			mj = rpm.GetRule(RoutingPreferenceRuleGroupType.MechanicalJoints,i)
			mjId = mj.MEPPartId
			mjElement = doc.GetElement(mjId)
			subList.append(mjElement.FamilyName + ":" + mjElement.ToDSType(True).Name)
	else:
		mjNames.append(["Empty"])
	

for t in types:
	rpm = t.RoutingPreferenceManager
	nRules = rpm.GetNumberOfRules(RoutingPreferenceRuleGroupType.Caps)
	if nRules>0:
		subList = []
		pipeCapNames.append(subList)
		for i in range(0,nRules):
			pipeCap = rpm.GetRule(RoutingPreferenceRuleGroupType.Caps,i)
			pipeCapId = pipeCap.MEPPartId
			pipeCapElement = doc.GetElement(pipeCapId)
			subList.append(pipeCapElement.FamilyName + ":" + pipeCapElement.ToDSType(True).Name)
	else:
		pipeCapNames.append(["Empty"])


for t in types:
	rpm = t.PreferredJunctionType
	prefJunction.append([rpm])








OUT = [[t.ToDSType(True).Name] for t in types], pipeSegmentNames, pipeElbowNames, pipeJunctionNames, pipeCrossNames, pipeTransitionNames, pipeUnionNames, mjNames, pipeCapNames, prefJunction, errors



#OUT = doc.GetElement(typesItems[0].RoutingPreferenceManager.GetRule(RoutingPreferenceRuleGroupType.Crosses, 0).MEPPartId).FamilyName + ":"+ doc.GetElement(typesItems[0].RoutingPreferenceManager.GetRule(RoutingPreferenceRuleGroupType.Crosses, 0).MEPPartId).ToDSType(True).Name
# ----------------------------------------
code_block_4 = CodeBlock { -1; }
dropItems = List.DropItems(list=python_script, amount=code_block_4)
python_script_2 = Python(IN[0]=dropItems)
# ---------- python_script_2.python (13 lines) ----------
lista = IN[0]
result = []

for item in lista:
	subList = []
	result.append(subList)
	for i in item:
		if len(i)>1:
			subList.append(i[0] + " & " + i[1])
		else:
			subList.append(i[0])
		
OUT = result
# ----------------------------------------
transpose = List.Transpose(lists=python_script_2)
addItemToFront = List.AddItemToFront(item=code_block_3, list=transpose)
exportExcel = Data.ExportExcel(filePath=file_path, sheetName=code_block, startRow=code_block_2, startCol=code_block_2, data=addItemToFront)
code_block_5 = CodeBlock(a=dropItems) { a[0][0]; }
file_path_2 = Filename("..\Desktop\target.rvt")
openDocumentFile = Rhythm.Revit.Application.Application.OpenDocumentFile(filePath=file_path_2)
