# Dynamo graph dynaserver.dyn (Dynamo 2.0.1.5055)

string = StringInput(" http://localhost:1234/Nodes/Add/")  # graph input
string_2 = StringInput(" http://localhost:1234/Nodes/Position/")  # graph input
code_block = CodeBlock()
# ---------- code_block.designscript (11 lines) ----------
["==",
"Code Block",
"Element.Name",
"List.FilterByBoolMask",
"==",
"String from Object",
"Code Block",
"Element.GetCategory",
"Input",
"Output",
"List.FilterByBoolMask"];
# ----------------------------------------
string_3 = StringInput(";")
code_block_2 = CodeBlock()
# ---------- code_block_2.designscript (11 lines) ----------
[1890.631962,
1581.454203,
1587.631962,
1345.936265,
1047.631962,
753.0001238,
736.6319618,
399.3558301,
149.0363015,
2505.330013,
2220.677187];
# ----------------------------------------
code_block_3 = CodeBlock()
# ---------- code_block_3.designscript (11 lines) ----------
[304.5495383,
474.1514473,
265.5495383,
90.50525995,
291.5495383,
238.3604792,
348.7628717,
258.0603876,
53.50322318,
78.28853303,
76.73272644];
# ----------------------------------------
code_block_4 = CodeBlock(a=string_2, b=code_block, c=string_3, x=code_block_2, e=string_3, y=code_block_3) { a+b+c+x+e+y; }

# group: Dynamo core node
# note: The "Web Request" node in the Core Dynamo library :
# - builds a web request to the URL provided
# - executes it as well.
# The node always builds a GET request.
web_request = WebRequest(url=code_block_4)

# group: Response
watch = Watch(web_request)
