# Dynamo graph editFamily01.dyn (Dynamo 1.3.3.4651)

file_path = Filename("..\Documents\GioBro\Arup_Beam_Steel Asymmetric I Section.rfa")
string = StringInput("C:\Users\giovanni.brogiolo\Documents\GioBro")
refresh = BoolSelector(false)
python_script = Python(IN[0]=string, IN[1]=refresh)
# ---------- python_script.python (7 lines) ----------
from System.IO import Directory, SearchOption
dir = IN[0]

if Directory.Exists(dir):
	OUT = Directory.GetFiles(dir)
else:
	OUT = list()
# ----------------------------------------
refresh_2 = BoolSelector(false)
python_script_2 = Python(IN[0]=python_script, IN[1]=refresh_2)  # frozen
# ---------- python_script_2.python (69 lines) ----------
import clr

clr.AddReference("RevitServices")
import RevitServices
from RevitServices.Persistence import DocumentManager
from RevitServices.Transactions import TransactionManager

clr.AddReference('RevitAPI')
clr.AddReference('RevitAPIUI')
from Autodesk.Revit.DB import *
from Autodesk.Revit.UI import *

doc = DocumentManager.Instance.CurrentDBDocument
uidoc=DocumentManager.Instance.CurrentUIApplication.ActiveUIDocument

app = DocumentManager.Instance.CurrentUIApplication.Application

filePath = IN[0]



def purgeFamily(app, filePath):
	open_file = app.OpenAndActivateDocument(filePath)
	fm = open_file.FamilyManager
	deleted = 0
	error = []
	y = Transaction(open_file, "Put in parameter")
	y.Start()

	subTr = SubTransaction(open_file)
	subTr.Start()
	
	familyTypes = fm.Types
	
	count = familyTypes.Size
	
	while count > 1:
		fm.DeleteCurrentType()
		count -=1
	
	try:
		fm.RenameCurrentType("Default")
	except:
		error.append("Default Type already present")
	
	#run the purge command
	
	familyApp = open_file.Application;
	uiapp = UIApplication( familyApp )
	
	
	pCmd = RevitCommandId.LookupPostableCommandId(PostableCommand.PurgeUnused)
	uiapp.PostCommand(pCmd)

	subTr.Commit()
	
	y.Commit()
	
	open_file.Close()
	
	return count

error = []

for file in filePath:
	error.append(purgeFamily(app, file))
	

OUT = error
# ----------------------------------------
code_block = CodeBlock(a=python_script) { a[0]; }
python_script_3 = Python(IN[0]=code_block)
# ---------- python_script_3.python (20 lines) ----------
import clr

clr.AddReference("RevitServices")
import RevitServices
from RevitServices.Persistence import DocumentManager
from RevitServices.Transactions import TransactionManager

clr.AddReference('RevitAPI')
clr.AddReference('RevitAPIUI')
from Autodesk.Revit.DB import *
from Autodesk.Revit.UI import *

doc = DocumentManager.Instance.CurrentDBDocument
uidoc=DocumentManager.Instance.CurrentUIApplication.ActiveUIDocument

app = doc.Application
uiapp = UIApplication( app )
uidoc2 = uiapp.OpenAndActivateDocument( IN[0] )

OUT = uidoc2
# ----------------------------------------
