# Dynamo graph elementInSpace.dyn (Dynamo 1.3.1.1736)

select_model_elements = DSModelElementsSelection()
categories = Categories("LightingFixtures")
all_elements_of_category = ElementsOfCategory(categories)
categories_2 = Categories("MEPSpaces")
all_elements_of_category_2 = ElementsOfCategory(categories_2)
elements_in_space = Custom[Elements in Space](Element=all_elements_of_category, Space=all_elements_of_category_2)  # This node will take an input of Spaces and Elements and attempt to group all elements by Room that it is located in. For elements that are placed by Line and not a Point, a mid point of line will be used to determine location.
python_script = Python()  # unwired: IN[0], IN[1]
# ---------- python_script.python (87 lines) ----------
#Copyright(c) 2015, Konrad Sobon
# @arch_laboratory, http://archi-lab.net

# This code is based on Family.InRoom node originally created
# by Peter Kompolschek and published on Dynamo blog. Big thanks 
# to Peter for sharing his work so graciously.

import clr
import sys
clr.AddReference('ProtoGeometry')
from Autodesk.DesignScript.Geometry import *

pyt_path = r'C:\Program Files (x86)\IronPython 2.7\Lib'
sys.path.append(pyt_path)

# Import ToDSType(bool) extension method
clr.AddReference("RevitNodes")
import Revit
clr.ImportExtensions(Revit.Elements)

# Import DocumentManager and TransactionManager
clr.AddReference("RevitServices")
import RevitServices
from RevitServices.Persistence import DocumentManager
from RevitServices.Transactions import TransactionManager

# Import RevitAPI
clr.AddReference("RevitAPI")
import Autodesk
from Autodesk.Revit.DB import *

doc = DocumentManager.Instance.CurrentDBDocument
uiapp = DocumentManager.Instance.CurrentUIApplication
app = uiapp.Application

#The inputs to this node will be stored as a list in the IN variable.
dataEnteringNode = IN

def TryGetSpace(family, phase):
	try:
		inSpace = family.Space[phase]
	except:
		inSpace = None
		pass
	return inSpace

def FamiliesInSpace(_space, _families, _doc):
	outList = []
	for family in _families:
		location = family.Location
		if type(location) == LocationPoint:
			pt = location.Point
		else:
			pt = location.Curve.Evaluate(0.5, True)
		if _space.IsPointInSpace(pt):
			outList.append(family)
		else:
			for phase in _doc.Phases:
				inSpace = TryGetSpace(family, phase)
				if inSpace != None and inSpace.ToDSType(True).Name == _space.ToDSType(True).Name:
					outList.append(family)
	return outList

try:
	errorReport = None
	families = []
	for i in IN[0]:
		families.append(UnwrapElement(i))
	
	spaces = []
	for i in IN[1]:
		if UnwrapElement(i).Area > 0:
			spaces.append(UnwrapElement(i))
	
	outData = [[] for i in range(len(spaces))]
	for index, space in enumerate(spaces):
		outData[index].extend(FamiliesInSpace(space, families, doc))
except:
	# if error accurs anywhere in the process catch it
	import traceback
	errorReport = traceback.format_exc()

#Assign your output to the OUT variable
if errorReport == None:
	OUT = outData
else:
	OUT = errorReport
# ----------------------------------------
space = RevitElements.FamilyInstance.Space(all_elements_of_category)
groupByKey = List.GroupByKey(list=all_elements_of_category, keys=space)
