# Dynamo graph elementLineInView.dyn (Dynamo 1.3.2.2480)

current = Document.Current()
activeView = Document.ActiveView(current)
select_model_elements = DSModelElementsSelection()  # 2 picked in the model
curves = Element.Curves(select_model_elements)
select_model_elements_2 = DSModelElementsSelection()  # 4 picked in the model
curves_2 = Element.Curves(select_model_elements_2)
code_block = CodeBlock(a=curves, b=curves_2) { Flatten({a,b}); }
intersectAll = Curve.IntersectAll(code_block)
code_block_2 = CodeBlock { 4; }
chop = List.Chop(list=intersectAll, lengths=code_block_2)
deconstruct = List.Deconstruct(list=chop)
byStartPointEndPoint = Line.ByStartPointEndPoint(startPoint=deconstruct.first, endPoint=deconstruct.rest)
byCurve = DetailCurve.ByCurve(activeView, byStartPointEndPoint)
select_model_element = DSModelElementSelection()
curves_3 = Element.Curves(select_model_element)
plane = Custom[View.Plane](view=activeView)  # Retrieves the plane of a given view
current_2 = Document.Current()
activeView_2 = Document.ActiveView(current_2)
byCurve_2 = DetailCurve.ByCurve(activeView_2)  # unwired: arg1
select_model_element_2 = DSModelElementSelection()
curves_4 = Element.Curves(select_model_element_2)
select_model_elements_3 = DSModelElementsSelection()  # 2 picked in the model
curves_5 = Element.Curves(select_model_elements_3)
select_model_elements_4 = DSModelElementsSelection()  # 4 picked in the model
curves_6 = Element.Curves(select_model_elements_4)
code_block_3 = CodeBlock(a=curves_5, b=curves_6) { Flatten({a,b}); }
intersectAll_2 = Curve.IntersectAll(code_block_3)
code_block_4 = CodeBlock { 4; }
chop_2 = List.Chop(list=intersectAll_2, lengths=code_block_4)
deconstruct_2 = List.Deconstruct(list=chop_2)
byStartPointEndPoint_2 = Line.ByStartPointEndPoint(startPoint=deconstruct_2.first, endPoint=deconstruct_2.rest, lacing=Longest)
byCurve_3 = Custom[DetailCurve.ByCurve+](curve=byStartPointEndPoint_2, view=activeView_2)  # Creates a detail line based on a given curve. Unlike the OOTB node it can also draw circles.
