# Dynamo graph elementsFromLinkedModel.dyn (Dynamo 2.0.2.6826)

python_script = Python()
# ---------- python_script.python (50 lines) ----------
#Copyright(c) 2015, Konrad K Sobon
# @arch_laboratory, http://archi-lab.net

# Huge thanks to Andreas Dieckmann for 
# adding link path functionality

import clr
clr.AddReference('ProtoGeometry')
from Autodesk.DesignScript.Geometry import *

# Import DocumentManager and TransactionManager
clr.AddReference("RevitServices")
import RevitServices
from RevitServices.Persistence import DocumentManager
from RevitServices.Transactions import TransactionManager

from System.Collections.Generic import *

# Import RevitAPI
clr.AddReference("RevitAPI")
import Autodesk
from Autodesk.Revit.DB import *
from Autodesk.Revit.DB.Analysis import *

doc = DocumentManager.Instance.CurrentDBDocument
uiapp = DocumentManager.Instance.CurrentUIApplication
app = uiapp.Application

# Import ToDSType(bool) extension method
clr.AddReference("RevitNodes")
import Revit
clr.ImportExtensions(Revit.Elements)

#The inputs to this node will be stored as a list in the IN variable.
dataEnteringNode = IN

collector = Autodesk.Revit.DB.FilteredElementCollector(doc)
linkInstances = collector.OfClass(Autodesk.Revit.DB.RevitLinkInstance)

linkDoc, linkName, linkPath = [], [], []
for i in linkInstances:
	linkDoc.append(i.GetLinkDocument())
	linkName.append(i.Name)
	try:
		linkPath.append(i.GetLinkDocument().PathName)
	except:
		linkPath.append(None)
		pass

OUT = linkDoc, linkName, linkInstances, linkPath
# ----------------------------------------
code_block = CodeBlock { 2; }
getItemAtIndex = List.GetItemAtIndex(list=python_script, index=code_block)
code_block_2 = CodeBlock(a=python_script) { a[0]; }

# group: All elements
python_script_2 = Python(IN[0]=code_block_2)
# ---------- python_script_2.python (44 lines) ----------
#Copyright(c) 2015, Konrad Sobon
# @arch_laboratory, http://archi-lab.net

# This node is based on Julien Benoit's Element.GetElementFromLinkedFile 
# node. Some slight improvements were made removing unnecessary imports/references.
# Big thank you to Julien for sharing his work. 

import clr
clr.AddReference('ProtoGeometry')
from Autodesk.DesignScript.Geometry import *

# Import RevitAPI
clr.AddReference("RevitAPI")
import Autodesk
from Autodesk.Revit.DB import *

import System

import sys
pyt_path = r'C:\Program Files (x86)\IronPython 2.7\Lib'
sys.path.append(pyt_path)

#The inputs to this node will be stored as a list in the IN variable.
dataEnteringNode = IN

_linkDoc = IN[0]

result = []

for l in _linkDoc:
	subList = []
	result.append(subList)
	try:
		errorReport = None
		fec = FilteredElementCollector(l).WhereElementIsNotElementType().ToElements()
		for f in fec:
			if f.Category != None and f.ViewSpecific == False and f.Category.HasMaterialQuantities == True:
				subList.append(f)
	except:
		# if error accurs anywhere in the process catch it
		import traceback
		errorReport = traceback.format_exc()

OUT = result
# ----------------------------------------

# group: Unfreeze to run
python_scrpit = Python(IN[0]=getItemAtIndex, IN[1]=python_script_2)  # frozen
# ---------- python_scrpit.python (84 lines) ----------
import clr

clr.AddReference('RevitServices')
from RevitServices.Persistence import DocumentManager
from RevitServices.Transactions import TransactionManager
doc = DocumentManager.Instance.CurrentDBDocument

clr.AddReference('RevitAPI')
from Autodesk.Revit.DB import *

from System.Collections.Generic import List

clr.AddReference('RevitNodes')
import Revit
clr.ImportExtensions(Revit.Elements)

import System

import sys
pyt_path = r'C:\Program Files (x86)\IronPython 2.7\Lib'
sys.path.append(pyt_path)


def singleton(x):
	if hasattr(x,'__iter__'): return x[0]
	else : return x

def tolist(x):
	if hasattr(x,'__iter__'): return x
	else : return [x]


linkInst = UnwrapElement(singleton(IN[0]) )
elements = UnwrapElement(tolist(IN[1]) )



copy = List[ElementId]()
error = []


class CustomCopyHandler(IDuplicateTypeNamesHandler):
	def OnDuplicateTypeNamesFound(self, args):
		return DuplicateTypeAction.UseDestinationTypes

def CopyElements(RVTlinkInst, elementsToCopy):
	linkDoc = RVTlinkInst.GetLinkDocument()
	tf1 = linkInst.GetTotalTransform()
	eId = List[ElementId]()
	
	for e in elements:
		try:
			id1 = e.Id
		except:
			continue
		eId.Add(id1)
	pasteOption = CopyPasteOptions()
	pasteOption.SetDuplicateTypeNamesHandler(CustomCopyHandler())
	for e in elements:
	try:
		eids = List[ElementId]()
		eids.Add(e.Id)
		copy.Add(ElementTransformUtils.CopyElements(linkDoc, eids, doc, tf1, pasteOption)[0])
	except:
		import traceback
		error = traceback.format_exc()
		#error.append(["error", e])





TransactionManager.Instance.EnsureInTransaction(doc)


TransactionManager.Instance.TransactionTaskDone()


OUT = []
for i in copy:
	e = doc.GetElement(i)
	if e is not None:
		OUT.append(e.ToDSType(False))
OUT.append(error)
# ----------------------------------------

name = Element.Name(element=python_script_2)
