# Dynamo graph elementsFromLinkedModel02.dyn (Dynamo 2.0.2.6826)

# group: refresh
boolean = BoolSelector(true)

python_script = Python(IN[0]=boolean)
# ---------- python_script.python (52 lines) ----------
#Copyright(c) 2015, Konrad K Sobon
# @arch_laboratory, http://archi-lab.net

# Huge thanks to Andreas Dieckmann for 
# adding link path functionality

import clr
clr.AddReference('ProtoGeometry')
from Autodesk.DesignScript.Geometry import *

# Import DocumentManager and TransactionManager
clr.AddReference("RevitServices")
import RevitServices
from RevitServices.Persistence import DocumentManager
from RevitServices.Transactions import TransactionManager

from System.Collections.Generic import *

# Import RevitAPI
clr.AddReference("RevitAPI")
import Autodesk
from Autodesk.Revit.DB import *
from Autodesk.Revit.DB.Analysis import *

doc = DocumentManager.Instance.CurrentDBDocument
uiapp = DocumentManager.Instance.CurrentUIApplication
app = uiapp.Application


refresh = IN[0]
# Import ToDSType(bool) extension method
clr.AddReference("RevitNodes")
import Revit
clr.ImportExtensions(Revit.Elements)

#The inputs to this node will be stored as a list in the IN variable.
dataEnteringNode = IN

collector = Autodesk.Revit.DB.FilteredElementCollector(doc)
linkInstances = collector.OfClass(Autodesk.Revit.DB.RevitLinkInstance)

linkDoc, linkName, linkPath = [], [], []
for i in linkInstances:
	linkDoc.append(i.GetLinkDocument())
	linkName.append(i.Name)
	try:
		linkPath.append(i.GetLinkDocument().PathName)
	except:
		linkPath.append(None)
		pass

OUT = linkDoc, linkName, linkInstances, linkPath
# ----------------------------------------
code_block = CodeBlock { 2; }
getItemAtIndex = List.GetItemAtIndex(list=python_script, index=code_block)
code_block_2 = CodeBlock(a=python_script) { a[0]; }

# group: All elements
python_script_2 = Python(IN[0]=code_block_2)
# ---------- python_script_2.python (44 lines) ----------
#Copyright(c) 2015, Konrad Sobon
# @arch_laboratory, http://archi-lab.net

# This node is based on Julien Benoit's Element.GetElementFromLinkedFile 
# node. Some slight improvements were made removing unnecessary imports/references.
# Big thank you to Julien for sharing his work. 

import clr
clr.AddReference('ProtoGeometry')
from Autodesk.DesignScript.Geometry import *

# Import RevitAPI
clr.AddReference("RevitAPI")
import Autodesk
from Autodesk.Revit.DB import *

import System

import sys
pyt_path = r'C:\Program Files (x86)\IronPython 2.7\Lib'
sys.path.append(pyt_path)

#The inputs to this node will be stored as a list in the IN variable.
dataEnteringNode = IN

_linkDoc = IN[0]

result = []

for l in _linkDoc:
	subList = []
	result.append(subList)
	try:
		errorReport = None
		fec = FilteredElementCollector(l).WhereElementIsNotElementType().ToElements()
		for f in fec:
			if f.Category != None and f.ViewSpecific == False and f.Category.HasMaterialQuantities == True:
				subList.append(f)
	except:
		# if error accurs anywhere in the process catch it
		import traceback
		errorReport = traceback.format_exc()

OUT = result
# ----------------------------------------

# group: 2. Unfreeze to copy Elements
python_scrpit = Python(IN[0]=getItemAtIndex, IN[1]=python_script_2)  # frozen
# ---------- python_scrpit.python (62 lines) ----------
import clr

clr.AddReference('RevitServices')
from RevitServices.Persistence import DocumentManager
from RevitServices.Transactions import TransactionManager
doc = DocumentManager.Instance.CurrentDBDocument

clr.AddReference('RevitAPI')
from Autodesk.Revit.DB import *

from System.Collections.Generic import List

clr.AddReference('RevitNodes')
import Revit
clr.ImportExtensions(Revit.Elements)

import System

import sys
pyt_path = r'C:\Program Files (x86)\IronPython 2.7\Lib'
sys.path.append(pyt_path)



linkInst = UnwrapElement(IN[0])
elements = UnwrapElement(IN[1])


class CustomCopyHandler(IDuplicateTypeNamesHandler):
	def OnDuplicateTypeNamesFound(self, args):
		return DuplicateTypeAction.UseDestinationTypes


def CopyElements(RVTlinkInst, elementsToCopy, doc):

	copy = List[ElementId]()
	error = []
	linkDoc = RVTlinkInst.GetLinkDocument()
	tf1 = RVTlinkInst.GetTotalTransform()

	pasteOption = CopyPasteOptions()
	pasteOption.SetDuplicateTypeNamesHandler(CustomCopyHandler())
	
	for e in elementsToCopy:
		try:
			eids = List[ElementId]()
			eids.Add(e.Id)
			copy.Add(ElementTransformUtils.CopyElements(linkDoc, eids, doc, tf1, pasteOption)[0])
		except:
			import traceback
			error = traceback.format_exc()
			#error.append(["error", e])
	return [doc.GetElement(c) for c in copy]

OUT = []

TransactionManager.Instance.EnsureInTransaction(doc)

for i in range(0, len(linkInst)):
	OUT.append(CopyElements(linkInst[i], elements[i], doc))

TransactionManager.Instance.TransactionTaskDone()
# ----------------------------------------

# group: Exclude elements without a workplane (in = no workplane)
code_block_3 = CodeBlock { "Work Plane"; }
getParameterValueByName = Element.GetParameterValueByName(element=python_script_2, parameterName=code_block_3, lacing=Longest)
length = String.Length(str=getParameterValueByName)
code_block_4 = CodeBlock { 0; }
eq = length == code_block_4
filterByBoolMask = List.FilterByBoolMask(list=python_script_2, mask=eq)

python_script_3 = Python(IN[0]=code_block_2)
# ---------- python_script_3.python (43 lines) ----------
#Copyright(c) 2015, Konrad Sobon
# @arch_laboratory, http://archi-lab.net

# This node is based on Julien Benoit's Element.GetElementFromLinkedFile 
# node. Some slight improvements were made removing unnecessary imports/references.
# Big thank you to Julien for sharing his work. 

import clr
clr.AddReference('ProtoGeometry')
from Autodesk.DesignScript.Geometry import *

# Import RevitAPI
clr.AddReference("RevitAPI")
import Autodesk
from Autodesk.Revit.DB import *

import System

import sys
pyt_path = r'C:\Program Files (x86)\IronPython 2.7\Lib'
sys.path.append(pyt_path)

#The inputs to this node will be stored as a list in the IN variable.
dataEnteringNode = IN

_linkDoc = IN[0]

result = []

for l in _linkDoc:
	subList = []
	result.append(subList)
	try:
		errorReport = None
		fec = FilteredElementCollector(l).OfCategory(BuiltInCategory.OST_Levels).WhereElementIsNotElementType().ToElements()
		for f in fec:
			subList.append(f)
	except:
		# if error accurs anywhere in the process catch it
		import traceback
		errorReport = traceback.format_exc()

OUT = result
# ----------------------------------------

# group: 1. Unfreeze to copy Levels
python_scrpit_2 = Python(IN[0]=getItemAtIndex, IN[1]=python_script_3)  # frozen; same code as python_scrpit
