# Dynamo graph elementsInView.dyn (Dynamo 1.3.2.2480)

select_model_element = DSModelElementSelection()  # 1 picked in the model
categories = Categories("Sections")
categories_2 = Categories("Views")
all_elements_of_category = ElementsOfCategory(categories_2)

# group: from package manager
elements_in_view_s = Custom[Elements in View(s)](Views=all_elements_of_category)  # Gets all elements in given view(s).

python_script = Python()  # unwired: IN[0]
# ---------- python_script.python (23 lines) ----------
#Made by Marc Tavenier @marctavenier
import clr
clr.AddReference('RevitAPI')
from Autodesk.Revit.DB import *

clr.AddReference('RevitServices')
import RevitServices
from RevitServices.Persistence import DocumentManager

#The inputs to this node will be stored as a list in the IN variable.
dataEnteringNode = IN

views = UnwrapElement(IN[0])

elementlist = []
doc = DocumentManager.Instance.CurrentDBDocument

for view in views:
	collector = FilteredElementCollector(doc, view.Id)
	elementlist.append(collector.ToElements())

#Assign your output to the OUT variable
OUT = elementlist
# ----------------------------------------
elements_in_view_by_category = Custom[Elements in view by category]()  # Returns all the elements in the selected view(s) by the selected categor(y)(ies); unwired: View, Category
python_script_2 = Python()  # unwired: IN[0], IN[1]
# ---------- python_script_2.python (40 lines) ----------
import clr
clr.AddReference('RevitAPI')
from Autodesk.Revit.DB import *

clr.AddReference("RevitNodes")
import Revit
clr.ImportExtensions(Revit.Elements)
clr.ImportExtensions(Revit.GeometryConversion)

clr.AddReference("RevitServices")
import RevitServices
from RevitServices.Persistence import DocumentManager

doc = DocumentManager.Instance.CurrentDBDocument
toggle = 0
if isinstance(IN[0], list):
	view = UnwrapElement(IN[0])
else:
	toggle = 1
	view = [UnwrapElement(IN[0])]

if isinstance(IN[1], list):
	category = UnwrapElement(IN[1])
else:
	category = [UnwrapElement(IN[1])]
	
listout = []

for x in view:
	viewlist = []
	for c in category:
		collector = FilteredElementCollector(doc,x.Id)
		elements = collector.OfCategoryId(c.Id).ToElements()
		viewlist.append(elements)
	listout.append(viewlist)

if toggle:
	OUT = viewlist
else:
	OUT = listout
# ----------------------------------------
