# Dynamo graph ellipseBeam.dyn (Dynamo 1.3.2.2480)

select_model_element = DSModelElementSelection()  # 1 picked in the model
geometry = Element.Geometry(select_model_element)

# group: set number of division
code_block = CodeBlock { 7; }

code_block_2 = CodeBlock(division=code_block) { 0..1..#division; }
pointAtParameter = Curve.PointAtParameter(curve=geometry, param=code_block_2, lacing=Longest)
byPoints = PolyCurve.ByPoints(points=pointAtParameter)
explode = Geometry.Explode(byPoints)
levels = Levels("Level 1")
structural_framing_types = StructuralFramingTypes("UB152x89x16")
beamByCurve = StructuralFraming.BeamByCurve(curve=explode, level=levels, structuralFramingType=structural_framing_types)
