# Dynamo graph example2 - Copy.dyn (Dynamo 1.3.2.2480)

code_block = CodeBlock { 5; }
byCenterPointRadius = Circle.ByCenterPointRadius()
code_block_2 = CodeBlock { 19; }
divideCurve = Geometry.Curves.DivideCurve(byCenterPointRadius, code_block_2)
code_block_3 = CodeBlock { 4; }
byCenterPointRadius_2 = Circle.ByCenterPointRadius(radius=code_block_3)
divideCurve_2 = Geometry.Curves.DivideCurve(byCenterPointRadius_2, code_block_2)
byStartPointEndPoint = Line.ByStartPointEndPoint(startPoint=divideCurve, endPoint=divideCurve_2)
code_block_4 = CodeBlock { 0.5; }
pointAtParameter = Curve.PointAtParameter(curve=byStartPointEndPoint, param=code_block_4)
code_block_5 = CodeBlock { 1; }
create = List.Create(code_block_4, code_block_5)
code_block_6 = CodeBlock { 19/2; }
ofRepeatedItem = List.OfRepeatedItem(item=create, amount=code_block_6)
flatten = Flatten(ofRepeatedItem)
translate = Geometry.Translate(geometry=pointAtParameter, zTranslation=flatten)
byThreePoints = Arc.ByThreePoints(firstPoint=divideCurve, secondPoint=translate, thirdPoint=divideCurve_2)
byLoft = Surface.ByLoft(byThreePoints)
byRuledLoft = Surface.ByRuledLoft(byThreePoints)
byLoft_2 = Surface.ByLoft(byThreePoints, byCenterPointRadius)
