# Dynamo graph example2A.dyn (Dynamo 2.0.1.4955)

select_model_element = DSModelElementSelection()  # 1 picked in the model
curves = Element.Curves(element=select_model_element)
integer_slider = IntegerSlider(19, range=0..100 step 1)
divideCurve = Geometry.Curves.DivideCurve(curve=curves, Number=integer_slider)
select_model_element_2 = DSModelElementSelection()  # 1 picked in the model
curves_2 = Element.Curves(element=select_model_element_2)
divideCurve_2 = Geometry.Curves.DivideCurve(curve=curves_2, Number=integer_slider)
byStartPointEndPoint = Line.ByStartPointEndPoint(startPoint=divideCurve.Points, endPoint=divideCurve_2.Points)
code_block = CodeBlock { 0.5; }
pointAtParameter = Curve.PointAtParameter(curve=byStartPointEndPoint, param=code_block)
integer_slider_2 = IntegerSlider(1000, range=2..10000 step 500)
integer_slider_3 = IntegerSlider(2000, range=3..10000 step 500)
list_create = List.Create(item0=integer_slider_2, item1=integer_slider_3)
code_block_2 = CodeBlock { 2; }
div = integer_slider / code_block_2
ofRepeatedItem = List.OfRepeatedItem(item=list_create, amount=div)
translate = Geometry.Translate(geometry=pointAtParameter@L1, zTranslation=ofRepeatedItem@L1)
byThreePoints = Arc.ByThreePoints(firstPoint=divideCurve.Points, secondPoint=translate@L3, thirdPoint=divideCurve_2.Points)
deconstruct = List.Deconstruct(list=byThreePoints@L2)
byLoft = Surface.ByLoft(crossSections=deconstruct.rest)
