# Dynamo graph example3.dyn (Dynamo 2.0.1.4955)

# group: START POINT
byCoordinates = Point.ByCoordinates()

# group: END POINT
code_block = CodeBlock { 30; }
byCoordinates_2 = Point.ByCoordinates(x=code_block)

# group: CREATE TOP CHORD
byStartPointEndPoint = Line.ByStartPointEndPoint(startPoint=byCoordinates, endPoint=byCoordinates_2)

# group: TRUSS DIVISIONS
number_slider = DoubleSlider(15, range=0..100 step 0.1)

# group: TRUSS DEPTH
number_slider_2 = DoubleSlider(3.8, range=0..100 step 0.1)

# group: BOTTOM CHORD
code_block_2 = CodeBlock { -1; }
mul = number_slider_2 * code_block_2
translate = Geometry.Translate(geometry=byStartPointEndPoint, zTranslation=mul)

# group: DIVIDE CHORDS
code_block_3 = CodeBlock(count=number_slider) { 0..1..#count; }
pointAtParameter = Curve.PointAtParameter(curve=byStartPointEndPoint, param=code_block_3)
pointAtParameter_2 = Curve.PointAtParameter(curve=translate, param=code_block_3)

# group: VERTICALS
byStartPointEndPoint_2 = Line.ByStartPointEndPoint(startPoint=pointAtParameter, endPoint=pointAtParameter_2)

# group: DIAGONALS
deconstruct = List.Deconstruct(list=pointAtParameter_2)
byStartPointEndPoint_3 = Line.ByStartPointEndPoint(startPoint=pointAtParameter, endPoint=deconstruct.rest)

code_block_4 = CodeBlock { 0; }

# group: DIAGONALS
deconstruct_2 = List.Deconstruct(list=pointAtParameter)
byStartPointEndPoint_4 = Line.ByStartPointEndPoint(startPoint=pointAtParameter_2, endPoint=deconstruct_2.rest)

# group: ELIMINATED UNWANTED DIAGONALS
count = List.Count(list=byStartPointEndPoint_3)
code_block_5 = CodeBlock { 2; }
div = count / code_block_5
chop = List.Chop(list=byStartPointEndPoint_3, lengths=div)
chop_2 = List.Chop(list=byStartPointEndPoint_4, lengths=div)

getItemAtIndex = List.GetItemAtIndex(list=chop, index=code_block_4)
code_block_6 = CodeBlock { 1; }
getItemAtIndex_2 = List.GetItemAtIndex(list=chop_2, index=code_block_6)
