# Dynamo graph faceVoidByLine.dyn (Dynamo 2.0.1.5055)

# group: Beams
boolean = BoolSelector(true)
python_script = Python(IN[0]=boolean)
# ---------- python_script.python (38 lines) ----------
import clr

clr.AddReference("RevitAPIUI")
from Autodesk.Revit.UI import IExternalEventHandler, ExternalEvent, TaskDialog
from Autodesk.Revit.UI.Selection import *

clr.AddReference("RevitAPI")
from Autodesk.Revit.DB import Transaction, OverrideGraphicSettings, ElementId, Color
# noinspection PyUnresolvedReferences
from Autodesk.Revit.Exceptions import InvalidOperationException


clr.AddReference('RevitServices')
from RevitServices.Persistence import DocumentManager


global result



doc = DocumentManager.Instance.CurrentDBDocument
uidoc = DocumentManager.Instance.CurrentUIApplication.ActiveUIDocument


class CustomISelectionFilter(ISelectionFilter):
	def __init__(self, category_name):
		self.category_name = category_name
	def AllowElement(self, e):
		if e.Category.Name == self.category_name:
			return True
		else:
			return False
	def AllowReference(self, ref, point):
		return false

ref = uidoc.Selection.PickObjects(ObjectType.Element, CustomISelectionFilter("Structural Framing"), "Select Multiple Beams")

OUT = [doc.GetElement(r) for r in ref]
# ----------------------------------------

# group: Lines
boolean_2 = BoolSelector(true)
python_script_2 = Python(IN[0]=boolean_2)
# ---------- python_script_2.python (38 lines) ----------
import clr

clr.AddReference("RevitAPIUI")
from Autodesk.Revit.UI import IExternalEventHandler, ExternalEvent, TaskDialog
from Autodesk.Revit.UI.Selection import *

clr.AddReference("RevitAPI")
from Autodesk.Revit.DB import Transaction, OverrideGraphicSettings, ElementId, Color
# noinspection PyUnresolvedReferences
from Autodesk.Revit.Exceptions import InvalidOperationException


clr.AddReference('RevitServices')
from RevitServices.Persistence import DocumentManager


global result



doc = DocumentManager.Instance.CurrentDBDocument
uidoc = DocumentManager.Instance.CurrentUIApplication.ActiveUIDocument


class CustomISelectionFilter(ISelectionFilter):
	def __init__(self, category_name):
		self.category_name = category_name
	def AllowElement(self, e):
		if e.Category.Name == self.category_name:
			return True
		else:
			return False
	def AllowReference(self, ref, point):
		return false

ref = uidoc.Selection.PickObjects(ObjectType.Element, CustomISelectionFilter("Lines"), "Select Lines")

OUT = [doc.GetElement(r) for r in ref]
# ----------------------------------------

python_script_3 = Python(IN[0]=python_script, IN[1]=python_script_2)
# ---------- python_script_3.python (92 lines) ----------
import clr
clr.AddReference('ProtoGeometry')
from Autodesk.DesignScript.Geometry import *

# Import DocumentManager and TransactionManager
clr.AddReference("RevitServices")
import RevitServices
from RevitServices.Persistence import DocumentManager
from RevitServices.Transactions import TransactionManager

# Import RevitAPI
clr.AddReference("RevitAPI")
import Autodesk
from Autodesk.Revit.DB import *

import clr
clr.AddReference("RevitNodes")
import Revit
# Import ToProtoType, ToRevitType geometry conversion extension methods
clr.ImportExtensions(Revit.GeometryConversion)

def GetDoubleParVal(element, paramName):
	for p in element.Parameters:
		if p.Definition.Name == paramName:
			return p.AsString()
	
def distance(st, end):
	return ((end.X-st.X)**2+(end.Y-st.Y)**2)**0.5
	

def GetStartPointToBeamFaceDistance(beam):
	opt = Options()
	opt.ComputeReferences = True
	opt.IncludeNonVisibleObjects = False
	
	solids = beam.get_Geometry(opt)
	faces = []
	for obj in solids:
		if isinstance(obj, Solid):
			faces.Add(obj.Faces)
	faceAreas = []
	
	for fa in faces:
		areas = []
		for f in fa:
			areas.append(f.Area)
			faceAreas.append(f.Area)
	
	minArea = min(faceAreas)
	verFace = []
	for fa in faces:
		for f in fa:
			if int(f.Area) == int(minArea):
				verFace.append(f)
			
	stPt = beam.Location.Curve.GetEndPoint(0)
	
	return min(distance(verFace[1].Origin,stPt)*304.8,distance(verFace[0].Origin,stPt)*304.8)




beams = UnwrapElement(IN[0])
penoLine = UnwrapElement(IN[1])

result = []

for b in beams:
	beamCrv = b.Location.Curve.ToProtoType()
	beamStPt = beamCrv.PointAtParameter(0)
	count = 0
	for p in penoLine:
		crv = p.Location.Curve.ToProtoType()		
		intPt = Geometry.Intersect(beamCrv, crv)		
		if intPt:
			dist = int(distance(intPt[0], beamStPt)-GetStartPointToBeamFaceDistance(b))
			#subList.append(intPt[0])			
			#subList.append(beamStPt)
			penoSize = p.LineStyle.Name.Split(" ")[3].Split("x")
			depth = int(penoSize[1])
			try:
				width = int(penoSize[0])
			except:
				width = 0
			mark = 	GetDoubleParVal(b, "Mark")
			count +=1
			result.append([b, dist, depth, width, "offset N/A", "stiffener N/A", mark, count])
		else:
			continue

# Assign your output to the OUT variable.
OUT = result
# ----------------------------------------
code_block = CodeBlock { "Web_Peno_R"; }
byName = FamilyType.ByName(name=code_block)
code_block_2 = CodeBlock { "Web_Peno_C"; }
byName_2 = FamilyType.ByName(name=code_block_2)
refresh = BoolSelector(true)

# group: GeometryElement.Solid
python_script_4 = Python(IN[0]=python_script_3, IN[1]=byName, IN[2]=byName_2, IN[3]=refresh)
# ---------- python_script_4.python (227 lines) ----------
import clr

clr.AddReference('RevitAPI')
from Autodesk.Revit.DB import *
from Autodesk.Revit.DB.Structure import *

clr.AddReference('RevitAPIUI')
from Autodesk.Revit.UI import *

clr.AddReference('System')
from System.Collections.Generic import List

clr.AddReference('RevitNodes')
import Revit
clr.ImportExtensions(Revit.GeometryConversion)
clr.ImportExtensions(Revit.Elements)

clr.AddReference('RevitServices')
import RevitServices
from RevitServices.Persistence import DocumentManager
from RevitServices.Transactions import TransactionManager

doc = DocumentManager.Instance.CurrentDBDocument
uidoc=DocumentManager.Instance.CurrentUIApplication.ActiveUIDocument


def GetEndFaces(beam):
	opt = Options()
	opt.ComputeReferences = True
	opt.IncludeNonVisibleObjects = False
	
	solids = beam.get_Geometry(opt)
	faces = []
	for obj in solids:
		if isinstance(obj, Solid):
			faces.Add(obj.Faces)
	faceAreas = []
	
	for fa in faces:
		#areas = []
		for f in fa:
			#areas.append(f.Area)
			faceAreas.append(f.Area)
	
	minArea = min(faceAreas)
	verFace = []
	for fa in faces:
		for f in fa:
			if int(f.Area) == int(minArea):
				verFace.append(f)
	return verFace

def GetBeamWidth(beam):
	face = GetEndFaces(beam)[0]
	faceBB = face.GetBoundingBox()
	faceBBmax = faceBB.Max.V
	faceBBmin = faceBB.Min.V
	return (faceBBmax-faceBBmin)*304.8
	
# get the largest surface in a solid (i.e. the web face of the steel beam)
def GetFaceFromSolids(solids):
	faces = []
	for obj in solids:
		if isinstance(obj, Solid):
			faces.Add(obj.Faces)

	webFace = None

	for fa in faces:
		areas = []
		for f in fa:
			areas.append(f.Area)
		try:
			webFace = fa[areas.IndexOf(max(areas))]
		except:
			continue
	return webFace


def ExtractSymbolGeometry(beam, geometry):
	#instance = None
	symbolGeometry = None
	transform = None
	for item in geometry:
		try:
			#instance = item.GetInstanceGeometry()
			symbolGeometry = item.GetSymbolGeometry()
			transform = item.Transform
			
		except:
			continue
	
	return [GetFaceFromSolids(symbolGeometry), transform]

"""
def GetBeamWidth(element):
	opt = Options()
	opt.ComputeReferences = True
	opt.IncludeNonVisibleObjects = False
	opt.View = doc.ActiveView
	width = 250/304.8
	for instance in element.get_Geometry(opt):
		try:
			geomInst = instance.GetSymbolGeometry()
			instTransform = instance.Transform;
			width = (geomInst.GetBoundingBox().Max.Y - geomInst.GetBoundingBox().Min.Y)
		except:
			continue
	if width<200/304.8:
		newWidth = 250/304.8
	else:
		newWidth = width
	return newWidth
"""

def GetBeamDirection(beam):
	return beam.Location.Curve.GetEndPoint(0) - beam.Location.Curve.GetEndPoint(1)


def SetVoidSize(void, distance, width, height, mark, id, beam):
		p = void.LookupParameter("P_Distance from Start")
		p.Set(distance/304.8)
		w = void.LookupParameter("P_Void Width")
		w.Set(width/304.8)
		h = void.LookupParameter("P_Void Depth")
		h.Set(height/304.8)
		t = void.LookupParameter("P_Beam Tag")
		t.Set(mark)
		s = void.LookupParameter("P_Penetration Id")
		s.Set(id)
		y = void.LookupParameter("P_Symbol Height")
		y.Set(GetBeamWidth(beam)/304.8)
		
def SetCircularVoidSize(void, distance, height, mark, id, beam):
		p = void.LookupParameter("P_Distance from Start")
		p.Set(distance/304.8)
		h = void.LookupParameter("P_Void Depth")
		h.Set(height/304.8)
		t = void.LookupParameter("P_Beam Tag")
		t.Set(mark)
		s = void.LookupParameter("P_Penetration Id")
		s.Set(id)
		y = void.LookupParameter("P_Symbol Height")
		y.Set(GetBeamWidth(beam)/304.8)

ele = IN[0]



def PlaceVoids(ele, distance, width, height, mark, id):
	webFace = None
	
	opt = Options()
	opt.ComputeReferences = True
	opt.IncludeNonVisibleObjects = False
	
	instTransform = None;
	
	geometry = ele.get_Geometry(opt)
	
	solids = []
	for obj in geometry:
		solids.append(obj)
		#geo.append(obj.ConvertToMany())

	selectedFace = GetFaceFromSolids(geometry)
	
	if selectedFace == None:
		selectedFace = ExtractSymbolGeometry(ele, geometry)[0]
		instTransform = ExtractSymbolGeometry(ele, geometry)[1]

	bboxUV = selectedFace.GetBoundingBox()
	center = (bboxUV.Max + bboxUV.Min) * 0.5;
	start = bboxUV.Min;
	end = bboxUV.Max
	length = abs(bboxUV.Min.U - bboxUV.Max.U)
	
	midV = abs(start.V - end.V)/2
	
	location = selectedFace.Evaluate(UV(start.U, midV));
	
	#loc = selectedFace.Evaluate(start);
	
	normal = selectedFace.ComputeNormal(center);
	refDir = normal.CrossProduct(XYZ.BasisZ);
	
	#refDirBeam = beam.HandOrientation
	#origin = beam.GetTransform().Origin

	voidFamily = UnwrapElement(IN[1])
	
	circularVoidFamily = UnwrapElement(IN[2])
	
	voids = []
	
	used = []
	
	TransactionManager.Instance.EnsureInTransaction(doc)
	
	if len(solids) == 1:
		transformedPoint = instTransform.OfPoint(location);
		#direction = GetBeamDirection(ele)
		if width>0:
			void = doc.Create.NewFamilyInstance.Overloads[Face, XYZ, XYZ, FamilySymbol](selectedFace, transformedPoint, GetBeamDirection(ele), voidFamily);
			SetVoidSize(void, distance, width, height, mark, id, ele)
		else:
			void = doc.Create.NewFamilyInstance.Overloads[Face, XYZ, XYZ, FamilySymbol](selectedFace, transformedPoint, GetBeamDirection(ele), circularVoidFamily);
			SetCircularVoidSize(void, distance, height, mark, id, ele)
		voids.append(void)
		used.append("instance")
	else:
		if width>0:
			void = doc.Create.NewFamilyInstance.Overloads[Face, XYZ, XYZ, FamilySymbol](selectedFace, location,  GetBeamDirection(ele), voidFamily);
			SetVoidSize(void, distance, width, height, mark, id, ele)
		else:
			void = doc.Create.NewFamilyInstance.Overloads[Face, XYZ, XYZ, FamilySymbol](selectedFace, location,  GetBeamDirection(ele), circularVoidFamily);
			SetCircularVoidSize(void, distance, height, mark, id, ele)
		voids.append(void)
		used.append("solid")
		
	#void = doc.Create.NewFamilyInstance(location,fs,normal,beam,StructuralType.NonStructural);
	
	TransactionManager.Instance.TransactionTaskDone()
	return voids[0], used[0]


OUT = [PlaceVoids(UnwrapElement(e[0]), float(e[1]), int(e[3]), int(e[2]), e[6], str(e[7])) for e in ele]
# ----------------------------------------

python_script_5 = Python(IN[0]=python_script)
# ---------- python_script_5.python (87 lines) ----------
import clr
clr.AddReference('ProtoGeometry')
from Autodesk.DesignScript.Geometry import *

# Import DocumentManager and TransactionManager
clr.AddReference("RevitServices")
import RevitServices
from RevitServices.Persistence import DocumentManager
from RevitServices.Transactions import TransactionManager

# Import RevitAPI
clr.AddReference("RevitAPI")
import Autodesk
from Autodesk.Revit.DB import *


clr.AddReference("RevitNodes")
import Revit
# Import ToProtoType, ToRevitType geometry conversion extension methods
clr.ImportExtensions(Revit.GeometryConversion)

import math

beams = UnwrapElement(IN[0])

doc = DocumentManager.Instance.CurrentDBDocument
getDocUnits = doc.GetUnits()
getDisplayUnits = getDocUnits.GetFormatOptions(UnitType.UT_Length).DisplayUnits 




def distance(st, end):
	return ((end.X-st.X)**2+(end.Y-st.Y)**2)**0.5

	
def GetStartPointToBeamFaceDistance(beam):
	
	endFaces = GetEndFaces(beam)		
	stPt = beam.Location.Curve.GetEndPoint(0)
	
	return min(distance(endFaces[1].Origin,stPt)*304.8,distance(endFaces[0].Origin,stPt)*304.8)

def GetEndFaces(beam):
	opt = Options()
	opt.ComputeReferences = True
	opt.IncludeNonVisibleObjects = False
	
	solids = beam.get_Geometry(opt)
	faces = []
	for obj in solids:
		if isinstance(obj, Solid):
			faces.Add(obj.Faces)
	faceAreas = []
	
	for fa in faces:
		#areas = []
		for f in fa:
			#areas.append(f.Area)
			faceAreas.append(f.Area)
	
	minArea = min(faceAreas)
	verFace = []
	for fa in faces:
		for f in fa:
			if int(f.Area) == int(minArea):
				verFace.append(f)
	return verFace

def GetBeamWidth(beam):
	face = GetEndFaces(beam)[0]
	faceBB = face.GetBoundingBox()
	faceBBmax = faceBB.Max.V
	faceBBmin = faceBB.Min.V
	return (faceBBmax-faceBBmin)*304.8

result = []

for b in beams:
	try:
		result.append(GetBeamWidth(b))
	except:
		result.append("error")



OUT = result
# ----------------------------------------

# group: 1 beam
# note: depthxwidth
# if circular -> depthx0
code_block_3 = CodeBlock(a=python_script) { [a]; }
