# Dynamo graph familyIsInPlace01.dyn (Dynamo 1.3.1.1736)

python_script = Python()  # unwired: IN[0]
# ---------- python_script.python (31 lines) ----------
import clr
clr.AddReference("ProtoGeometry")
from Autodesk.DesignScript.Geometry import *
# Import RevitAPI
clr.AddReference("RevitAPI")
from Autodesk.Revit.DB import *
clr.AddReference("RevitAPIUI")
from Autodesk.Revit.UI import TaskDialog
# Import DocumentManager and TransactionManager
clr.AddReference("RevitServices")
from RevitServices.Persistence import DocumentManager
from RevitServices.Transactions import TransactionManager
# Import ToProtoType, ToRevitType geometry conversion extension methods
clr.AddReference("RevitNodes")
import Revit
clr.ImportExtensions(Revit.GeometryConversion)

doc = DocumentManager.Instance.CurrentDBDocument
uiapp = DocumentManager.Instance.CurrentUIApplication
app = uiapp.Application

list = FilteredElementCollector(doc).OfClass(FamilySymbol).ToElements()

inPlaceFamily = []

for l in list:
	if l.Family.IsInPlace == True:
		inPlaceFamily.append(l)
	
#Assign your output to the OUT variable.
OUT = inPlaceFamily
# ----------------------------------------
byFamilyType = FamilyInstance.ByFamilyType(python_script)
python_script_2 = Python()  # unwired: IN[0], IN[1]
# ---------- python_script_2.python (26 lines) ----------
import System
import clr
clr.AddReference('RevitAPI')
from Autodesk.Revit.DB import *

clr.AddReference("RevitServices")
import RevitServices
from RevitServices.Persistence import DocumentManager

doc = DocumentManager.Instance.CurrentDBDocument
famtypes = UnwrapElement(IN[0])

elementlist = list()
for ft in famtypes:
	collector = FilteredElementCollector(doc)
	bic = System.Enum.ToObject(BuiltInCategory, ft.Category.Id.IntegerValue)
	collector.OfCategory(bic)
	# This is a workaround
	# because I was to lazy to learn
	# how to implement LINQ in Python
	ftlist =  list()
	for item in collector.ToElements():
		if item.GetTypeId().IntegerValue == ft.Id.IntegerValue:
			ftlist.append(item)
	elementlist.append(ftlist)
OUT = elementlist
# ----------------------------------------
select_model_elements = DSModelElementsSelection()  # 6 picked in the model
isInPlace = WombatDynamo.FamilyInstance.IsInPlace()  # unwired: arg0
map = List.Map(list=select_model_elements, f_x=isInPlace)
filterByBoolMask = List.FilterByBoolMask(list=select_model_elements, mask=map)
