# Dynamo graph familyIsInPlace_08-01.dyn (Dynamo 0.8.2.2392)

select_model_element = DSModelElementSelection()  # 1 picked in the model
code_block = CodeBlock(a=select_model_element) { {a}; }
python_script = Python(IN[0]=code_block)
# ---------- python_script.python (27 lines) ----------
import System
import clr
clr.AddReference('RevitAPI')
from Autodesk.Revit.DB import *

clr.AddReference("RevitServices")
import RevitServices
from RevitServices.Persistence import DocumentManager

doc = DocumentManager.Instance.CurrentDBDocument
famtypes = UnwrapElement(IN[0])

elementlist = list()

for ft in famtypes:
	collector = FilteredElementCollector(doc)
	bic = System.Enum.ToObject(BuiltInCategory, ft.Category.Id.IntegerValue)
	collector.OfCategory(bic)
	# This is a workaround
	# because I was to lazy to learn
	# how to implement LINQ in Python
	#ftlist =  list()
	for item in collector.ToElements():
		if item.GetTypeId().IntegerValue == ft.Id.IntegerValue:
			elementlist.append(item)
	#elementlist.append(ftlist)
OUT = famtypes[0].Symbol
# ----------------------------------------
code_block_2 = CodeBlock(a=python_script) { {a}; }

# group: These are the in-place elements
python_script_2 = Python(IN[0]=code_block_2)
# ---------- python_script_2.python (27 lines) ----------
import System
import clr
clr.AddReference('RevitAPI')
from Autodesk.Revit.DB import *

clr.AddReference("RevitServices")
import RevitServices
from RevitServices.Persistence import DocumentManager

doc = DocumentManager.Instance.CurrentDBDocument
famtypes = UnwrapElement(IN[0])

elementlist = list()

for ft in famtypes:
	collector = FilteredElementCollector(doc)
	bic = System.Enum.ToObject(BuiltInCategory, ft.Category.Id.IntegerValue)
	collector.OfCategory(bic)
	# This is a workaround
	# because I was to lazy to learn
	# how to implement LINQ in Python
	#ftlist =  list()
	for item in collector.ToElements():
		if item.GetTypeId().IntegerValue == ft.Id.IntegerValue:
			elementlist.append(item)
	#elementlist.append(ftlist)
OUT = elementlist
# ----------------------------------------

code_block_3 = CodeBlock { 255; }
byARGB = Color.ByARGB(r=code_block_3)
overrideColorInView = Element.OverrideColorInView(element=python_script_2, color=byARGB)

# group: Family Types in linked file
empty = List.Empty()
python_script_3 = Python(IN[0]=empty)
# ---------- python_script_3.python (43 lines) ----------
#Copyright(c) 2015, Konrad K Sobon
# @arch_laboratory, http://archi-lab.net

import clr
clr.AddReference('ProtoGeometry')
from Autodesk.DesignScript.Geometry import *

# Import DocumentManager and TransactionManager
clr.AddReference("RevitServices")
import RevitServices
from RevitServices.Persistence import DocumentManager
from RevitServices.Transactions import TransactionManager

from System.Collections.Generic import *

# Import RevitAPI
clr.AddReference("RevitAPI")
import Autodesk
from Autodesk.Revit.DB import *
from Autodesk.Revit.DB.Analysis import *

doc = DocumentManager.Instance.CurrentDBDocument
uiapp = DocumentManager.Instance.CurrentUIApplication
app = uiapp.Application

# Import ToDSType(bool) extension method
clr.AddReference("RevitNodes")
import Revit
clr.ImportExtensions(Revit.Elements)

#The inputs to this node will be stored as a list in the IN variable.
dataEnteringNode = IN

collector = Autodesk.Revit.DB.FilteredElementCollector(doc)
linkInstances = collector.OfClass(Autodesk.Revit.DB.RevitLinkInstance)

linkDoc, linkName = [], []
for i in linkInstances:
	linkDoc.append(i.GetLinkDocument())
	linkName.append(i.Name)


OUT = linkDoc, linkName, linkInstances
# ----------------------------------------
python_script_4 = Python(IN[0]=python_script_3)
# ---------- python_script_4.python (41 lines) ----------
import clr
clr.AddReference("ProtoGeometry")
from Autodesk.DesignScript.Geometry import *
# Import RevitAPI
clr.AddReference("RevitAPI")
from Autodesk.Revit.DB import *
clr.AddReference("RevitAPIUI")
from Autodesk.Revit.UI import TaskDialog
# Import DocumentManager and TransactionManager
clr.AddReference("RevitServices")
from RevitServices.Persistence import DocumentManager
from RevitServices.Transactions import TransactionManager
# Import ToProtoType, ToRevitType geometry conversion extension methods
clr.AddReference("RevitNodes")
import Revit
clr.ImportExtensions(Revit.GeometryConversion)

doc = DocumentManager.Instance.CurrentDBDocument
uiapp = DocumentManager.Instance.CurrentUIApplication
app = uiapp.Application

_linkDoc = IN[0]


names = []


collector = FilteredElementCollector(_linkDoc[0][0])

collector.OfClass(FamilySymbol)

#Assign your output to the OUT variable.
OUT = collector.ToElements()

"""
import System

import sys
pyt_path = r'C:\Program Files (x86)\IronPython 2.7\Lib'
sys.path.append(pyt_path)
"""
# ----------------------------------------

# group: Select all the family types
python_script_5 = Python()
# ---------- python_script_5.python (36 lines) ----------
import clr
clr.AddReference("ProtoGeometry")
from Autodesk.DesignScript.Geometry import *
# Import RevitAPI
clr.AddReference("RevitAPI")
from Autodesk.Revit.DB import *
clr.AddReference("RevitAPIUI")
from Autodesk.Revit.UI import TaskDialog
# Import DocumentManager and TransactionManager
clr.AddReference("RevitServices")
from RevitServices.Persistence import DocumentManager
from RevitServices.Transactions import TransactionManager
# Import ToProtoType, ToRevitType geometry conversion extension methods
clr.AddReference("RevitNodes")
import Revit
clr.ImportExtensions(Revit.GeometryConversion)

doc = DocumentManager.Instance.CurrentDBDocument
uiapp = DocumentManager.Instance.CurrentUIApplication
app = uiapp.Application


names = []

collector = FilteredElementCollector(doc).OfClass(FamilySymbol)

#Assign your output to the OUT variable.
OUT = collector.ToElements()

"""
import System

import sys
pyt_path = r'C:\Program Files (x86)\IronPython 2.7\Lib'
sys.path.append(pyt_path)
"""
# ----------------------------------------

# group: Check if they are in-place
python_script_6 = Python(IN[0]=python_script_5)
# ---------- python_script_6.python (31 lines) ----------
import clr
clr.AddReference("ProtoGeometry")
from Autodesk.DesignScript.Geometry import *
# Import RevitAPI
clr.AddReference("RevitAPI")
from Autodesk.Revit.DB import *
clr.AddReference("RevitAPIUI")
from Autodesk.Revit.UI import TaskDialog
# Import DocumentManager and TransactionManager
clr.AddReference("RevitServices")
from RevitServices.Persistence import DocumentManager
from RevitServices.Transactions import TransactionManager
# Import ToProtoType, ToRevitType geometry conversion extension methods
clr.AddReference("RevitNodes")
import Revit
clr.ImportExtensions(Revit.GeometryConversion)


list = UnwrapElement(IN[0])

family = []

for l in list:
	try:
		a = l.Family.IsInPlace
		family.append(a)
	except:
		family.append(False)

#Assign your output to the OUT variable.
OUT = family
# ----------------------------------------

filterByBoolMask = List.FilterByBoolMask(list=python_script_5, mask=python_script_6)
code_block_4 = CodeBlock(a=filterByBoolMask.in) { a[0]; }
python_script_7 = Python(IN[0]=code_block_4)
# ---------- python_script_7.python (42 lines) ----------
import System
import clr
clr.AddReference("ProtoGeometry")
from Autodesk.DesignScript.Geometry import *
# Import RevitAPI
clr.AddReference("RevitAPI")
from Autodesk.Revit.DB import *
clr.AddReference("RevitAPIUI")
from Autodesk.Revit.UI import TaskDialog
# Import DocumentManager and TransactionManager
clr.AddReference("RevitServices")
from RevitServices.Persistence import DocumentManager
from RevitServices.Transactions import TransactionManager
# Import ToProtoType, ToRevitType geometry conversion extension methods
clr.AddReference("RevitNodes")
import Revit
clr.ImportExtensions(Revit.GeometryConversion)

doc = DocumentManager.Instance.CurrentDBDocument
uiapp = DocumentManager.Instance.CurrentUIApplication
app = uiapp.Application

famtypes = UnwrapElement(IN[0])

elementlist = list()

collector = FilteredElementCollector(doc)

bic = System.Enum.ToObject(BuiltInCategory, -2000151)

collector.OfCategory(bic)

# Equivalent to:
#result = FilteredElementCollector(doc).OfCategory(BuiltInCategory.OST_GenericModel).ToElements()

resultIds = []

for item in collector:
	resultIds.append(item.GetTypeId())

#Assign your output to the OUT variable.
OUT = famtypes.Category.Id, collector.ToElements(), resultIds, famtypes.Id, 
# ----------------------------------------
python_script_8 = Python()  # same code as python_script_2
python_script_9 = Python(IN[0]=python_script_5)
# ---------- python_script_9.python (27 lines) ----------
import System
import clr
clr.AddReference('RevitAPI')
from Autodesk.Revit.DB import *

clr.AddReference("RevitServices")
import RevitServices
from RevitServices.Persistence import DocumentManager

doc = DocumentManager.Instance.CurrentDBDocument
famtypes = UnwrapElement(IN[0])

elementlist = list()

for ft in famtypes:
	collector = FilteredElementCollector(doc)
	bic = System.Enum.ToObject(BuiltInCategory, ft.Category.Id.IntegerValue)
	collector.OfCategory(bic)
	# This is a workaround
	# because I was to lazy to learn
	# how to implement LINQ in Python
	#ftlist =  list()
	for item in collector.ToElements():
		if item.GetTypeId().IntegerValue == ft.Id.IntegerValue:
			elementlist.append(item)
	#elementlist.append(ftlist)
OUT = famtypes[0].Id
# ----------------------------------------
