# Dynamo graph familyIsInPlace_08.dyn (Dynamo 0.8.2.2392)

all_elements_in_active_view = ElementsInView()

# group: Is in Place?
python_script = Python(IN[0]=all_elements_in_active_view)
# ---------- python_script.python (31 lines) ----------
import clr
clr.AddReference("ProtoGeometry")
from Autodesk.DesignScript.Geometry import *
# Import RevitAPI
clr.AddReference("RevitAPI")
from Autodesk.Revit.DB import *
clr.AddReference("RevitAPIUI")
from Autodesk.Revit.UI import TaskDialog
# Import DocumentManager and TransactionManager
clr.AddReference("RevitServices")
from RevitServices.Persistence import DocumentManager
from RevitServices.Transactions import TransactionManager
# Import ToProtoType, ToRevitType geometry conversion extension methods
clr.AddReference("RevitNodes")
import Revit
clr.ImportExtensions(Revit.GeometryConversion)


list = UnwrapElement(IN[0])

family = []

for l in list:
	try:
		a = l.Symbol.Family.IsInPlace
		family.append(a)
	except:
		family.append(False)

#Assign your output to the OUT variable.
OUT = family
# ----------------------------------------

filterByBoolMask = List.FilterByBoolMask(list=all_elements_in_active_view, mask=python_script)
code_block = CodeBlock { 255; }
byARGB = Color.ByARGB(r=code_block)
overrideColorInView = Element.OverrideColorInView(element=filterByBoolMask.in, color=byARGB)
select_model_element = DSModelElementSelection()
python_script_2 = Python(IN[0]=select_model_element)
# ---------- python_script_2.python (24 lines) ----------
import clr
clr.AddReference("ProtoGeometry")
from Autodesk.DesignScript.Geometry import *
# Import RevitAPI
clr.AddReference("RevitAPI")
from Autodesk.Revit.DB import *
clr.AddReference("RevitAPIUI")
from Autodesk.Revit.UI import TaskDialog
# Import DocumentManager and TransactionManager
clr.AddReference("RevitServices")
from RevitServices.Persistence import DocumentManager
from RevitServices.Transactions import TransactionManager
# Import ToProtoType, ToRevitType geometry conversion extension methods
clr.AddReference("RevitNodes")
import Revit
clr.ImportExtensions(Revit.GeometryConversion)


list = UnwrapElement(IN[0])

a = list.Symbol.Family.IsInPlace
	
#Assign your output to the OUT variable.
OUT = list.Symbol, list.Symbol.Family, a
# ----------------------------------------
python_script_3 = Python(IN[0]=all_elements_in_active_view)
# ---------- python_script_3.python (31 lines) ----------
import clr
clr.AddReference("ProtoGeometry")
from Autodesk.DesignScript.Geometry import *
# Import RevitAPI
clr.AddReference("RevitAPI")
from Autodesk.Revit.DB import *
clr.AddReference("RevitAPIUI")
from Autodesk.Revit.UI import TaskDialog
# Import DocumentManager and TransactionManager
clr.AddReference("RevitServices")
from RevitServices.Persistence import DocumentManager
from RevitServices.Transactions import TransactionManager
# Import ToProtoType, ToRevitType geometry conversion extension methods
clr.AddReference("RevitNodes")
import Revit
clr.ImportExtensions(Revit.GeometryConversion)


list = UnwrapElement(IN[0])

family = []

for l in list:
	try:
		a = l.Symbol.Family
		family.append(a)
	except:
		family.append(False)

#Assign your output to the OUT variable.
OUT = family
# ----------------------------------------
symbol = FamilyInstance.Symbol(select_model_element)
family = FamilySymbol.Family(symbol)
python_script_4 = Python(IN[0]=family)
# ---------- python_script_4.python (33 lines) ----------
import clr
clr.AddReference("ProtoGeometry")
from Autodesk.DesignScript.Geometry import *
# Import RevitAPI
clr.AddReference("RevitAPI")
from Autodesk.Revit.DB import *
clr.AddReference("RevitAPIUI")
from Autodesk.Revit.UI import TaskDialog
# Import DocumentManager and TransactionManager
clr.AddReference("RevitServices")
from RevitServices.Persistence import DocumentManager
from RevitServices.Transactions import TransactionManager
# Import ToProtoType, ToRevitType geometry conversion extension methods
clr.AddReference("RevitNodes")
import Revit
clr.ImportExtensions(Revit.GeometryConversion)

doc = DocumentManager.Instance.CurrentDBDocument
uiapp = DocumentManager.Instance.CurrentUIApplication
app = uiapp.Application

list = UnwrapElement(IN[0])

a = list.IsInPlace

names = []

ids = [i.Id for i in doc.Settings.Categories]

result = doc.Settings.Categories

#Assign your output to the OUT variable.
OUT = a, result
# ----------------------------------------
code_block_2 = CodeBlock { "a"; }
byName = FamilySymbol.ByName(code_block_2)
code_block_3 = CodeBlock(a=all_elements_in_active_view) { a[0]; }
symbol_2 = FamilyInstance.Symbol(code_block_3)
name = FamilySymbol.Name(symbol_2)
python_script_5 = Python()
# ---------- python_script_5.python (26 lines) ----------
import System
import clr
clr.AddReference('RevitAPI')
from Autodesk.Revit.DB import *

clr.AddReference("RevitServices")
import RevitServices
from RevitServices.Persistence import DocumentManager

doc = DocumentManager.Instance.CurrentDBDocument
famtypes = UnwrapElement(IN[0])

elementlist = list()
for ft in famtypes:
	collector = FilteredElementCollector(doc)
	bic = System.Enum.ToObject(BuiltInCategory, ft.Category.Id.IntegerValue)
	collector.OfCategory(bic)
	# This is a workaround
	# because I was to lazy to learn
	# how to implement LINQ in Python
	ftlist =  list()
	for item in collector.ToElements():
		if item.GetTypeId().IntegerValue == ft.Id.IntegerValue:
			ftlist.append(item)
	elementlist.append(ftlist)
OUT = elementlist
# ----------------------------------------
python_script_6 = Python()
# ---------- python_script_6.python (34 lines) ----------
import clr
clr.AddReference("ProtoGeometry")
from Autodesk.DesignScript.Geometry import *
# Import RevitAPI
clr.AddReference("RevitAPI")
from Autodesk.Revit.DB import *
clr.AddReference("RevitAPIUI")
from Autodesk.Revit.UI import TaskDialog
# Import DocumentManager and TransactionManager
clr.AddReference("RevitServices")
from RevitServices.Persistence import DocumentManager
from RevitServices.Transactions import TransactionManager
# Import ToProtoType, ToRevitType geometry conversion extension methods
clr.AddReference("RevitNodes")
import Revit
clr.ImportExtensions(Revit.GeometryConversion)

doc = DocumentManager.Instance.CurrentDBDocument
uiapp = DocumentManager.Instance.CurrentUIApplication
app = uiapp.Application


names = []

ids = [i.Id for i in doc.Settings.Categories]

result = doc.Settings.Categories

collector = FilteredElementCollector(doc)

collector.OfClass(FamilySymbol)

#Assign your output to the OUT variable.
OUT = collector.ToElements()
# ----------------------------------------
python_script_7 = Python(IN[0]=python_script_6)
# ---------- python_script_7.python (31 lines) ----------
import clr
clr.AddReference("ProtoGeometry")
from Autodesk.DesignScript.Geometry import *
# Import RevitAPI
clr.AddReference("RevitAPI")
from Autodesk.Revit.DB import *
clr.AddReference("RevitAPIUI")
from Autodesk.Revit.UI import TaskDialog
# Import DocumentManager and TransactionManager
clr.AddReference("RevitServices")
from RevitServices.Persistence import DocumentManager
from RevitServices.Transactions import TransactionManager
# Import ToProtoType, ToRevitType geometry conversion extension methods
clr.AddReference("RevitNodes")
import Revit
clr.ImportExtensions(Revit.GeometryConversion)


list = UnwrapElement(IN[0])

family = []

for l in list:
	try:
		a = l.Family.IsInPlace
		family.append(a)
	except:
		family.append(False)

#Assign your output to the OUT variable.
OUT = family
# ----------------------------------------
filterByBoolMask_2 = List.FilterByBoolMask(list=python_script_6, mask=python_script_7)
python_script_8 = Python(IN[0]=filterByBoolMask_2.in)
# ---------- python_script_8.python (27 lines) ----------
import System
import clr
clr.AddReference('RevitAPI')
from Autodesk.Revit.DB import *

clr.AddReference("RevitServices")
import RevitServices
from RevitServices.Persistence import DocumentManager

doc = DocumentManager.Instance.CurrentDBDocument
famtypes = UnwrapElement(IN[0])

elementlist = list()

for ft in famtypes:
	collector = FilteredElementCollector(doc)
	bic = System.Enum.ToObject(BuiltInCategory, ft.Category.Id.IntegerValue)
	collector.OfCategory(bic)
	# This is a workaround
	# because I was to lazy to learn
	# how to implement LINQ in Python
	#ftlist =  list()
	for item in collector.ToElements():
		if item.GetTypeId().IntegerValue == ft.Id.IntegerValue:
			elementlist.append(item)
	#elementlist.append(ftlist)
OUT = elementlist
# ----------------------------------------
code_block_4 = CodeBlock { 255; }
byARGB_2 = Color.ByARGB(r=code_block_4)
overrideColorInView_2 = Element.OverrideColorInView(element=python_script_8, color=byARGB_2)
