# Dynamo graph file assemble.dyn (Dynamo 2.0.0.3911)

string = StringInput("C:\Users\giovanni.brogiolo\Dropbox\QTO\1b2\New folder")
contentsAll = Custom[Directory.ContentsAll](directoryPath=string)  # Unlike the built-in node Directory.Contents, this node browses a directory recursively and returns all relevant files contained in subfolders as well.
code_block = CodeBlock(a=contentsAll) { a[3]; }
importCSV = ImportExport.ImportCSV(code_block, lacing=Longest)
importCSV_2 = ImportExport.ImportCSV(contentsAll)
flatten = List.Flatten(importCSV_2@L2, lacing=Longest)
code_block_2 = CodeBlock(a=flatten) { a[4][8]; }
indexOf = List.IndexOf(importCSV_2@L2, code_block_2, lacing=Longest)
