# Dynamo graph findClosestLevel_v08_01.dyn (Dynamo 0.8.2.2392)

categories = Categories("Walls")
all_elements_of_category = ElementsOfCategory()
code_block = CodeBlock { "Level"; }

# group: Level Names
code_block_2 = CodeBlock { {"B6","P5","B04","B03","B2","B1"}; }

# group: Level Elevation in mm
code_block_3 = CodeBlock { {0,4000,8810,14610,16000,20000}; }

boundingBox = Element.BoundingBox(all_elements_of_category)
minPoint = BoundingBox.MinPoint(boundingBox)
Z = Point.Z(minPoint)
python_script = Python(IN[0]=code_block_3, IN[1]=Z)
# ---------- python_script.python (6 lines) ----------
import clr

levels = IN[0]
toFind = IN[1]

OUT = [min(enumerate(levels), key=lambda x: abs(x[1]-f)) for f in toFind]
# ----------------------------------------
code_block_4 = CodeBlock { 0; }
getItemAtIndex = List.GetItemAtIndex(list=python_script, index=code_block_4, lacing=Longest)
getItemAtIndex_2 = List.GetItemAtIndex(list=code_block_2, index=getItemAtIndex)
maxPoint = BoundingBox.MaxPoint(boundingBox)
Z_2 = Point.Z(maxPoint)
python_script_2 = Python(IN[0]=code_block_3, IN[1]=Z_2)  # same code as python_script
code_block_5 = CodeBlock { 0; }
getItemAtIndex_3 = List.GetItemAtIndex(list=python_script_2, index=code_block_5, lacing=Longest)
getItemAtIndex_4 = List.GetItemAtIndex(list=code_block_2, index=getItemAtIndex_3)
code_block_6 = CodeBlock(bot=getItemAtIndex_2, top=getItemAtIndex_4) { bot + top; }
setParameterByName = Element.SetParameterByName(element=all_elements_of_category, parameterName=code_block, value=code_block_6)
categories_2 = Categories("StructuralFraming")
categories_3 = Categories("StructuralColumns")
code_block_7 = CodeBlock { {"Walls","Floors", "Structural Columns", "Structural Framing"}; }

# group: All categories
python_script_3 = Python(IN[0]=code_block_7)
# ---------- python_script_3.python (41 lines) ----------
import clr
# Import RevitAPI
clr.AddReference("RevitAPI")
from Autodesk.Revit.DB import *
clr.AddReference("RevitAPIUI")
from Autodesk.Revit.UI import TaskDialog
# Import DocumentManager and TransactionManager
clr.AddReference("RevitServices")
from RevitServices.Persistence import DocumentManager
from RevitServices.Transactions import TransactionManager
# Import ToProtoType, ToRevitType geometry conversion extension methods
clr.AddReference("RevitNodes")
import Revit
clr.ImportExtensions(Revit.Elements)
clr.ImportExtensions(Revit.GeometryConversion)



doc = DocumentManager.Instance.CurrentDBDocument
uiapp = DocumentManager.Instance.CurrentUIApplication
app = uiapp.Application

categories = doc.Settings.Categories;

model_cat = []

#exclude = ["dwg", "Tags", "Analytical", "Views", "Sections", "Dimensions"]

include = IN[0]

for c in categories:
	#if not ("dwg" in c.Name) and not ("Tags" in c.Name) and not ("Analytical" in c.Name) and not("View" in c.Name) nad not(:
	if (c.Name in include):
		try:
			name = (c.Name).replace(' ','')
			model_cat.append(Revit.Elements.Category.ByName("OST_"+name))
		except:
			"error"


OUT = model_cat, [c.Name for c in categories]
# ----------------------------------------

code_block_8 = CodeBlock(a=python_script_3) { a[0]; }
all_elements_of_category_2 = ElementsOfCategory(code_block_8)
watch = Watch(all_elements_of_category_2)
sortIndexByValue = SortIndexByValue()
code_block_9 = CodeBlock(a=python_script_3) { a[1]; }
sort = List.Sort(code_block_9)
python_script_4 = Python()
# ---------- python_script_4.python (37 lines) ----------
import clr
# Import RevitAPI
clr.AddReference("RevitAPI")
from Autodesk.Revit.DB import *
clr.AddReference("RevitAPIUI")
from Autodesk.Revit.UI import TaskDialog
# Import DocumentManager and TransactionManager
clr.AddReference("RevitServices")
from RevitServices.Persistence import DocumentManager
from RevitServices.Transactions import TransactionManager
# Import ToProtoType, ToRevitType geometry conversion extension methods
clr.AddReference("RevitNodes")
import Revit
clr.ImportExtensions(Revit.Elements)
clr.ImportExtensions(Revit.GeometryConversion)



doc = DocumentManager.Instance.CurrentDBDocument
uiapp = DocumentManager.Instance.CurrentUIApplication
app = uiapp.Application

categories = doc.Settings.Categories;

model_cat = []


for c in categories:
	if not ("Tag" in c.Name) and not ("View" in c.Name) and not ("Level" in c.Name) and not ("Dimension" in c.Name) and not ("Legend" in c.Name) and not ("Lines" in c.Name) and not ("Analytical" in c.Name) and not ("Elevation" in c.Name) and not ("Text" in c.Name) and not ("Sheet" in c.Name):
		name = (c.Name).replace(' ','')
		try:
			model_cat.append(Revit.Elements.Category.ByName("OST_"+name))
		except:
			"error"


OUT = model_cat
# ----------------------------------------
code_block_10 = CodeBlock { {"Tag","View","Level","Dimension","Legend","Lines","Analy","Elevation","Text","Sheet","Spot","Grid","Section","Material"}; }
python_script_5 = Python(IN[0]=code_block_10)
# ---------- python_script_5.python (47 lines) ----------
import clr
# Import RevitAPI
clr.AddReference("RevitAPI")
from Autodesk.Revit.DB import *
clr.AddReference("RevitAPIUI")
from Autodesk.Revit.UI import TaskDialog
# Import DocumentManager and TransactionManager
clr.AddReference("RevitServices")
from RevitServices.Persistence import DocumentManager
from RevitServices.Transactions import TransactionManager
# Import ToProtoType, ToRevitType geometry conversion extension methods
clr.AddReference("RevitNodes")
import Revit
clr.ImportExtensions(Revit.Elements)
clr.ImportExtensions(Revit.GeometryConversion)
from System.Collections.Generic import *
import System

doc = DocumentManager.Instance.CurrentDBDocument
uiapp = DocumentManager.Instance.CurrentUIApplication
app = uiapp.Application

categories = doc.Settings.Categories;

bics = System.Enum.GetValues(BuiltInCategory)

exclude = IN[0]

model_cat = []
names = []

for c in categories:
	if any(e in c.Name for e in exclude):
		"skip"
		#model_cat.append('exists')
	else:
		name = (c.Name).replace(' ','')
		try:
			model_cat.append(Revit.Elements.Category.ByName("OST_"+name))
			names.append("OST_"+name)
		except:
			"error"
#		model_cat.append('not')


#OUT = model_cat, [c.Name for c in model_cat], elements
OUT  = model_cat, names
# ----------------------------------------
code_block_11 = CodeBlock(a=python_script_5) { a[0]; }
all_elements_of_category_3 = ElementsOfCategory(code_block_11)
watch_2 = Watch(all_elements_of_category_3)
code_block_12 = CodeBlock(a=python_script_5) { a[1]; }
sort_2 = List.Sort(code_block_12)
flatten = Flatten()
parameters = Element.Parameters(flatten)
name = Parameter.Name(parameters)
code_block_13 = CodeBlock { "Location Code"; }
allIndicesOf = List.AllIndicesOf(list=name, item=code_block_13, lacing=Longest)
isEmpty = List.IsEmpty(allIndicesOf, lacing=Longest)
filterByBoolMask = List.FilterByBoolMask(list=flatten, mask=isEmpty)
code_block_14 = CodeBlock { {"Location Code","Discipline"}; }
code_block_15 = CodeBlock { {"1B4DS0","CA00"}; }
setParameterByName_2 = Element.SetParameterByName(parameterName=code_block_14, value=code_block_15, lacing=CrossProduct)
code_block_16 = CodeBlock { "Type"; }
getParameterValueByName = Element.GetParameterValueByName(element=flatten, parameterName=code_block_16)
python_script_6 = Python(IN[0]=code_block_10)
# ---------- python_script_6.python (55 lines) ----------
import clr
# Import RevitAPI
clr.AddReference("RevitAPI")
from Autodesk.Revit.DB import *
clr.AddReference("RevitAPIUI")
from Autodesk.Revit.UI import TaskDialog
# Import DocumentManager and TransactionManager
clr.AddReference("RevitServices")
from RevitServices.Persistence import DocumentManager
from RevitServices.Transactions import TransactionManager
# Import ToProtoType, ToRevitType geometry conversion extension methods
clr.AddReference("RevitNodes")
import Revit
clr.ImportExtensions(Revit.Elements)
clr.ImportExtensions(Revit.GeometryConversion)
from System.Collections.Generic import *
import System

doc = DocumentManager.Instance.CurrentDBDocument
uiapp = DocumentManager.Instance.CurrentUIApplication
app = uiapp.Application

categories = doc.Settings.Categories;

bics = System.Enum.GetValues(BuiltInCategory)

exclude = IN[0]

model_cat = []

builtInCats = List[BuiltInCategory]()


for c in categories:
	if any(e in c.Name for e in exclude):
		"skip"
	else:
		name = (c.Name).replace(' ','')
		model_cat.append("OST_"+name)

for b in bics:
	if b.ToString() in model_cat:
		builtInCats.Add(b)


filter1 = ElementMulticategoryFilter(builtInCats)

elements = FilteredElementCollector(doc).WherePasses(filter1).ToElements() 

id = [ e.GetTypeId() for e in elements]

type = [doc.GetElement( i ) for i in id]

#OUT = model_cat, [c.Name for c in model_cat], elements
OUT  = builtInCats, elements, type
# ----------------------------------------
