# Dynamo graph findFloors.dyn (Dynamo 2.1.0.6255)

# group: VerticalGrids
select_model_elements = DSModelElementsSelection()  # 137 picked in the model; graph input

curve = Grid.Curve(grid=select_model_elements)

# group: HorizontalGrids
select_model_elements_2 = DSModelElementsSelection()  # 59 picked in the model; graph input

curve_2 = Grid.Curve(grid=select_model_elements_2)
findIntersections = Geometry.Intersection.FindIntersections(geo=curve, others=curve_2)
flatten = List.Flatten(list=findIntersections)
name = Element.Name(element=select_model_elements)
name_2 = Element.Name(element=select_model_elements_2)

# group: create grid intersection points
python_script = Python(IN[0]=flatten, IN[1]=name, IN[2]=name_2)  # frozen
# ---------- python_script.python (27 lines) ----------
import clr

#The inputs to this node will be stored as a list in the IN variables.
class GridPoint():
	def __init__(self):
		self.Point = None
		self.Name = None
		self.vGrid = None
		self.hGrid = None
		pass

gridObjects= []

for vGrid in IN[1]:
	for hGrid in IN[2]:
		instance = GridPoint()
		instance.Name = vGrid+"-"+hGrid
		instance.vGrid = vGrid
		instance.hGrid = hGrid
		gridObjects.append(instance)

for g,p in zip(gridObjects, IN[0]):
	g.Point = p


#Assign your output to the OUT variable.
OUT = gridObjects
# ----------------------------------------

# group: get the grid names
python_script_2 = Python(IN[0]=python_script)
# ---------- python_script_2.python (12 lines) ----------
import clr
clr.AddReference('ProtoGeometry')
from Autodesk.DesignScript.Geometry import *
#The inputs to this node will be stored as a list in the IN variables.

list = []

for l in IN[0]:
	subout = l.Name
	list.append(subout)
	
OUT = list
# ----------------------------------------

# group: get the point xyz
python_script_3 = Python(IN[0]=python_script)
# ---------- python_script_3.python (12 lines) ----------
import clr
clr.AddReference('ProtoGeometry')
from Autodesk.DesignScript.Geometry import *
#The inputs to this node will be stored as a list in the IN variables.

list = []

for l in IN[0]:
	subout = l.Point
	list.append(subout)
	
OUT = list
# ----------------------------------------

code_block = CodeBlock { Vector.ZAxis(); }
code_block_2 = CodeBlock { 1; }
current = Document.Current()
activeView = Document.ActiveView(document=current)
byOriginDirection = Revit.References.RayBounce.ByOriginDirection(origin=python_script_3, direction=code_block, maxBounces=code_block_2, view=activeView)
code_block_3 = CodeBlock { "Mark"; }
getParameterValueByName = Element.GetParameterValueByName(element=byOriginDirection.elements, parameterName=code_block_3)
intersectAll = Geometry.IntersectAll(geometry=curve, others=curve_2, lacing=CrossProduct)
