# Dynamo graph findUnusedViewTemplate.dyn (Dynamo 2.0.1.4955)

categories = Categories(index=587)
all_elements_of_category = ElementsOfCategory(Category=categories)
removeNulls = Lists.Manage.RemoveNulls(Data=all_elements_of_category)
isViewTemplate = View.IsViewTemplate(view=removeNulls.Cleaned)
filterByBoolMask = List.FilterByBoolMask(list=removeNulls.Cleaned, mask=isViewTemplate)
viewTemplate = archilab.Revit.Views.Views.ViewTemplate(view=all_elements_of_category)
removeNulls_2 = Lists.Manage.RemoveNulls(Data=viewTemplate)
name = Element.Name(element=removeNulls_2.Cleaned)
name_2 = Element.Name(element=filterByBoolMask.in)
allIndicesOf = List.AllIndicesOf(list=name, item=name_2)
isEmpty = List.IsEmpty(list=allIndicesOf, lacing=Longest)
filterByBoolMask_2 = List.FilterByBoolMask(list=filterByBoolMask.in, mask=isEmpty)
name_3 = Element.Name(element=filterByBoolMask_2.in)
delete = archilab.Revit.Elements.Elements.Delete()  # unwired: element
python_script = Python()  # unwired: IN[0]
# ---------- python_script.python (34 lines) ----------
import clr

clr.AddReference('RevitAPI')
from Autodesk.Revit.DB import *
from Autodesk.Revit.DB.Structure import *

clr.AddReference('RevitAPIUI')
from Autodesk.Revit.UI import *

clr.AddReference('System')
from System.Collections.Generic import List

clr.AddReference('RevitNodes')
import Revit
clr.ImportExtensions(Revit.GeometryConversion)
clr.ImportExtensions(Revit.Elements)

clr.AddReference('RevitServices')
import RevitServices
from RevitServices.Persistence import DocumentManager
from RevitServices.Transactions import TransactionManager

doc = DocumentManager.Instance.CurrentDBDocument
uidoc=DocumentManager.Instance.CurrentUIApplication.ActiveUIDocument

#Preparing input from dynamo to revit
element = UnwrapElement(IN[0])

#Do some action in a Transaction
TransactionManager.Instance.EnsureInTransaction(doc)

TransactionManager.Instance.TransactionTaskDone()

OUT = 0
# ----------------------------------------
