# Dynamo graph framingOffsetCheck.dyn (Dynamo 2.0.1.4955)

select_model_elements = DSModelElementsSelection()  # 253 picked in the model
type = Object.Type()  # unwired: obj
groupByFunction = List.GroupByFunction(list=select_model_elements, func=type)
code_block = CodeBlock(a=groupByFunction) { a[0]; }
location = StructuralFraming.Location(structuralFraming=code_block)
code_block_2 = CodeBlock { [0,1]; }
pointAtParameter = Curve.PointAtParameter(curve=location, param=code_block_2, lacing=CrossProduct)
ZAxis = Vector.ZAxis()
code_block_3 = CodeBlock { 2; }
current = Document.Current()
activeView = Document.ActiveView(document=current)
byOriginDirection = Revit.References.RayBounce.ByOriginDirection(origin=pointAtParameter, direction=ZAxis, maxBounces=code_block_3, view=activeView)
code_block_4 = CodeBlock(a=byOriginDirection.points) { a; }
code_block_5 = CodeBlock(a=byOriginDirection.elements) { a; }
python_script = Python(IN[0]=code_block_5)
# ---------- python_script.python (13 lines) ----------
import clr
#Preparing input from dynamo to revit
element = UnwrapElement(IN[0])

subResult = []

for e in element:
	if not e[0] and not e[1]:
  		subResult.append("empty")
  	else:
  		subResult.append("not empty")

OUT = subResult
# ----------------------------------------
code_block_6 = CodeBlock { "not empty"; }
allIndicesOf = List.AllIndicesOf(list=python_script, item=code_block_6)
getItemAtIndex = List.GetItemAtIndex(list=code_block_4, index=allIndicesOf)
getItemAtIndex_2 = List.GetItemAtIndex(list=code_block, index=allIndicesOf)
code_block_7 = CodeBlock(a=groupByFunction) { a[1]; }
code_block_8 = CodeBlock { "Height Offset From Level"; }
getParameterValueByName = Element.GetParameterValueByName(element=code_block_7, parameterName=code_block_8)
code_block_9 = CodeBlock(a=code_block_7) { a[0]; }
lime = Custom[Color.Lime]()  # Returns the colour lime.
overrideColorInView = Element.OverrideColorInView(element=code_block_9, color=lime)
boundingBox = Element.BoundingBox(element=code_block_7)
getElementsIntersect = Revit.BoundingBox.GetElementsIntersect(boundingBox=boundingBox, elements=code_block)
code_block_10 = CodeBlock(a=getElementsIntersect) { a[0]; }
code_block_11 = CodeBlock { "z Offset Value"; }
getParameterValueByName_2 = Element.GetParameterValueByName(element=getElementsIntersect, parameterName=code_block_11)
code_block_12 = CodeBlock(a=getParameterValueByName_2) { a[0]; }
code_block_13 = CodeBlock { -170.0; }
allIndicesOf_2 = List.AllIndicesOf(list=code_block_12, item=code_block_13)
getItemAtIndex_3 = List.GetItemAtIndex(list=code_block_10, index=allIndicesOf_2)
yellow = Custom[Color.Yellow]()  # Returns the colour yellow.
overrideColorInView_2 = Element.OverrideColorInView(element=getItemAtIndex_3, color=yellow)
