# Dynamo graph getAreaCurveLoops.dyn (Dynamo 1.3.0.875)

python_script = Python()  # unwired: IN[0]
# ---------- python_script.python (35 lines) ----------
import clr
clr.AddReference("ProtoGeometry")
from Autodesk.DesignScript.Geometry import *
# Import RevitAPI
clr.AddReference("RevitAPI")
from Autodesk.Revit.DB import *
clr.AddReference("RevitAPIUI")
from Autodesk.Revit.UI import TaskDialog
# Import DocumentManager and TransactionManager
clr.AddReference("RevitServices")
from RevitServices.Persistence import DocumentManager
from RevitServices.Transactions import TransactionManager
# Import ToProtoType, ToRevitType geometry conversion extension methods
clr.AddReference("RevitNodes")
import Revit
clr.ImportExtensions(Revit.GeometryConversion)

area = UnwrapElement(IN[0])

opt = SpatialElementBoundaryOptions()

opt.StoreFreeBoundaryFaces = False

opt.SpatialElementBoundaryLocation.Center

profileLoops = []
segs = area.GetBoundarySegments(opt)

for i in range(0,len(segs)):
	outerProfileLoop = CurveLoop()
	profileLoops.Add(outerProfileLoop)	
	for j in range(0,len(segs[i])):
		outerProfileLoop.Append(segs[i][j].GetCurve())

OUT = profileLoops
# ----------------------------------------
code_block = CodeBlock(a=python_script) { a[0]; }
code_block_2 = CodeBlock { -100; }
byCoordinates = Point.ByCoordinates(z=code_block_2)
element_types = ElementTypes("AreaLoadType")
all_elements_of_type = ElementsOfType(element_types)
python_script_2 = Python(IN[0]=code_block, IN[1]=byCoordinates, IN[2]=all_elements_of_type)
# ---------- python_script_2.python (42 lines) ----------
import clr
clr.AddReference('ProtoGeometry')
from Autodesk.DesignScript.Geometry import *
#Import ToDSType(bool) extension method
clr.AddReference('RevitNodes')
import Revit
clr.ImportExtensions(Revit.GeometryConversion)
#Import DocumentManager and TransactionManager
clr.AddReference('RevitServices')
import RevitServices
from RevitServices.Persistence import DocumentManager
from RevitServices.Transactions import TransactionManager
from System.Collections.Generic import *
#import RevitAPI
clr.AddReference('RevitAPI')
import Autodesk
from Autodesk.Revit.DB import *
from Autodesk.Revit.DB.Structure import *
from System.Collections.Generic import *


doc = DocumentManager.Instance.CurrentDBDocument
uiapp = DocumentManager.Instance.CurrentUIApplication
app = uiapp.Application



profileLoops = UnwrapElement(IN[0])

F=IN[1]
loadtype=UnwrapElement(IN[2])


TransactionManager.Instance.EnsureInTransaction(doc)

listLoad= AreaLoad.Create(doc,profileLoops,F.ToXyz(False),loadtype[0])


TransactionManager.Instance.TransactionTaskDone()

#Assign your outputs to the OUT variable
OUT = listLoad
# ----------------------------------------
name = Element.Name(all_elements_of_type)
python_script_3 = Python()  # unwired: IN[0], IN[1], IN[2]
# ---------- python_script_3.python (74 lines) ----------
import clr
clr.AddReference('ProtoGeometry')
from Autodesk.DesignScript.Geometry import *
#Import ToDSType(bool) extension method
clr.AddReference('RevitNodes')
import Revit
clr.ImportExtensions(Revit.GeometryConversion)
#Import DocumentManager and TransactionManager
clr.AddReference('RevitServices')
import RevitServices
from RevitServices.Persistence import DocumentManager
from RevitServices.Transactions import TransactionManager
from System.Collections.Generic import *
#import RevitAPI
clr.AddReference('RevitAPI')
import Autodesk
from Autodesk.Revit.DB import *
from Autodesk.Revit.DB.Structure import *
from System.Collections.Generic import *


doc = DocumentManager.Instance.CurrentDBDocument
uiapp = DocumentManager.Instance.CurrentUIApplication
app = uiapp.Application


lista = IN[0]

profileLoops = []


for l in lista:
	if len(l)>1:
		oP = l[0]
		iP = l[1:]
		outerProfileLoop = CurveLoop()
		ip = []
		loops = [outerProfileLoop]
		profileLoops.Add(loops)	
		for i in range(0,len(oP)-1):
			outerProfileLoop.Append(Autodesk.Revit.DB.Line.CreateBound(XYZ(oP[i].X,oP[i].Y,oP[i].Z),XYZ(oP[i+1].X,oP[i+1].Y,oP[i+1].Z)))
		for j in range(0,len(iP)):
			innerProfileLoop = CurveLoop()
			loops.append(innerProfileLoop)
			for i in range(0,len(iP[j])-1):
				innerProfileLoop.Append(Autodesk.Revit.DB.Line.CreateBound(XYZ(iP[j][i].X,iP[j][i].Y,iP[j][i].Z),XYZ(iP[j][i+1].X,iP[j][i+1].Y,iP[j][i+1].Z)))					
	else:
		oP = l[0]
		outerProfileLoop = CurveLoop()
		profileLoops.Add([outerProfileLoop])
		for i in range(0,len(oP)-1):
			outerProfileLoop.Append(Autodesk.Revit.DB.Line.CreateBound(XYZ(oP[i].X,oP[i].Y,oP[i].Z),XYZ(oP[i+1].X,oP[i+1].Y,oP[i+1].Z)))
	

F=IN[1]
loadtype=UnwrapElement(IN[2])


TransactionManager.Instance.EnsureInTransaction(doc)

loads=[]


for j in range(0,len(loadtype)):
	listLoad = []
	loads.append(listLoad)
	for i in range(0,len(profileLoops)):
		listLoad.append(AreaLoad.Create(doc,profileLoops[i],F[j][i].ToXyz(False),loadtype[j]))


TransactionManager.Instance.TransactionTaskDone()

#Assign your outputs to the OUT variable
OUT = loads
# ----------------------------------------
select_model_element = DSModelElementSelection()
python_script_4 = Python(IN[0]=select_model_element, IN[1]=byCoordinates, IN[2]=all_elements_of_type)
# ---------- python_script_4.python (56 lines) ----------
import clr
clr.AddReference('ProtoGeometry')
from Autodesk.DesignScript.Geometry import *
#Import ToDSType(bool) extension method
clr.AddReference('RevitNodes')
import Revit
clr.ImportExtensions(Revit.GeometryConversion)
#Import DocumentManager and TransactionManager
clr.AddReference('RevitServices')
import RevitServices
from RevitServices.Persistence import DocumentManager
from RevitServices.Transactions import TransactionManager
from System.Collections.Generic import *
#import RevitAPI
clr.AddReference('RevitAPI')
import Autodesk
from Autodesk.Revit.DB import *
from Autodesk.Revit.DB.Structure import *
from System.Collections.Generic import *


doc = DocumentManager.Instance.CurrentDBDocument
uiapp = DocumentManager.Instance.CurrentUIApplication
app = uiapp.Application

area = UnwrapElement(IN[0])

opt = SpatialElementBoundaryOptions()

opt.StoreFreeBoundaryFaces = False

opt.SpatialElementBoundaryLocation.Center

profileLoops = []

segs = area.GetBoundarySegments(opt)

for i in range(0,len(segs)):
	pL = CurveLoop()
	profileLoops.Add(pL)	
	for j in range(0,len(segs[i])):
		pL.Append(segs[i][j].GetCurve())

F=IN[1]
loadtype=UnwrapElement(IN[2])


TransactionManager.Instance.EnsureInTransaction(doc)

listLoad= AreaLoad.Create(doc,profileLoops,F.ToXyz(False),loadtype[0])


TransactionManager.Instance.TransactionTaskDone()

#Assign your outputs to the OUT variable
OUT = listLoad, profileLoops
# ----------------------------------------
