# Dynamo graph getAreaCurveLoops01.dyn (Dynamo 1.3.1.1736)

select_model_elements = DSModelElementsSelection()  # 5 picked in the model
code_block = CodeBlock { -100; }
byCoordinates = Point.ByCoordinates(z=code_block)
element_types = ElementTypes("AreaLoadType")
all_elements_of_type = ElementsOfType(element_types)
python_script = Python(IN[0]=select_model_elements, IN[1]=byCoordinates, IN[2]=all_elements_of_type)
# ---------- python_script.python (57 lines) ----------
import clr
clr.AddReference('ProtoGeometry')
from Autodesk.DesignScript.Geometry import *
#Import ToDSType(bool) extension method
clr.AddReference('RevitNodes')
import Revit
clr.ImportExtensions(Revit.GeometryConversion)
#Import DocumentManager and TransactionManager
clr.AddReference('RevitServices')
import RevitServices
from RevitServices.Persistence import DocumentManager
from RevitServices.Transactions import TransactionManager
from System.Collections.Generic import *
#import RevitAPI
clr.AddReference('RevitAPI')
import Autodesk
from Autodesk.Revit.DB import *
from Autodesk.Revit.DB.Structure import *
from System.Collections.Generic import *


doc = DocumentManager.Instance.CurrentDBDocument
uiapp = DocumentManager.Instance.CurrentUIApplication
app = uiapp.Application

area = UnwrapElement(IN[0])
F=IN[1] #Force
loadtype=UnwrapElement(IN[2])

opt = SpatialElementBoundaryOptions()

opt.StoreFreeBoundaryFaces = False

opt.SpatialElementBoundaryLocation.Center

listLoad = []


TransactionManager.Instance.EnsureInTransaction(doc)



for i in range(0,len(area)):
	profileLoops = []
	segs = area[i].GetBoundarySegments(opt)
	for i in range(0,len(segs)):
		pL = CurveLoop()
		profileLoops.Add(pL)	
		for j in range(0,len(segs[i])):
			pL.Append(segs[i][j].GetCurve())
	listLoad.append(AreaLoad.Create(doc,profileLoops,F.ToXyz(False),loadtype[0]))


TransactionManager.Instance.TransactionTaskDone()

#Assign your outputs to the OUT variable
OUT = listLoad
# ----------------------------------------
