# Dynamo graph getSetExcel.dyn (Dynamo 2.0.1.4955)

file_path = Filename("C:\Testing\export.xls")
code_block = CodeBlock { "Revit Data"; }
code_block_2 = CodeBlock { 0; }

# group: Select all beams
categories = Categories(index=521)
all_elements_of_category = ElementsOfCategory(Category=categories)

# group: Group by type
code_block_3 = CodeBlock { "Type"; }
getParameterValueByName = Element.GetParameterValueByName(parameterName=code_block_3)  # unwired: element
groupByFunction = List.GroupByFunction(list=all_elements_of_category, func=getParameterValueByName)

# group: Find unique typemarks
getType = WombatDynamo.Element.GetType(element=groupByFunction)
code_block_4 = CodeBlock { "Identity_Type Mark"; }
getParameterValueByName_2 = Element.GetParameterValueByName(element=getType, parameterName=code_block_4)
uniqueItems = List.UniqueItems(list=getParameterValueByName_2@L2)

flatten = List.Flatten(list=uniqueItems)

# group: Find maximut length
code_block_5 = CodeBlock { "Length"; }
getParameterValueByName_3 = Element.GetParameterValueByName(element=groupByFunction, parameterName=code_block_5)
maximumItem = List.MaximumItem(list=getParameterValueByName_3)

list_create = List.Create(item0=flatten, item1=maximumItem)
transpose = List.Transpose(lists=list_create)
code_block_6 = CodeBlock { 0; }

# group: Write to Excel
exportExcel = Data.ExportExcel(filePath=file_path, sheetName=code_block, startRow=code_block_2, startCol=code_block_2, data=transpose, overWrite=code_block_6)  # frozen

code_block_7 = CodeBlock(a=groupByFunction) { a; }
code_block_8 = CodeBlock(a=code_block_7) { [a,a]; }
flatten_2 = List.Flatten(list=code_block_8@L3)
code_block_9 = CodeBlock { ["Comments","Mark"]; }
count = List.Count(list=code_block_7, lacing=Longest)
file_from_path = FileObject(path=file_path)
importExcel = Data.ImportExcel(file=file_from_path, sheetName=code_block)
transpose_2 = List.Transpose(lists=importExcel)
code_block_10 = CodeBlock { [0,1]; }
removeItemAtIndex = List.RemoveItemAtIndex(list=transpose_2, indices=code_block_10)
python_script = Python(IN[0]=count, IN[1]=removeItemAtIndex)
# ---------- python_script.python (17 lines) ----------
import clr

repeat = IN[0]
lista = IN[1]

result =[]

for l in lista:
	sub = []
	result.append(sub)
	for item,r in zip(l,repeat):
		subList = []
		sub.append(subList)
		for i in range(0,r):
			subList.append(item)

OUT = result
# ----------------------------------------
flatten_3 = List.Flatten(list=python_script@L3)
setParameterByName = Element.SetParameterByName(element=flatten_2, parameterName=code_block_9, value=flatten_3, lacing=Longest)
count_2 = List.Count()  # unwired: list
