# Dynamo graph getViewFilters.dyn (Dynamo 2.0.1.4955)

views = Views(index=57)
filters = View.Filters(view=views)
list_view_filter_information_for = Custom[List View Filter Information for View or Template](View_s=views)  # use with List.Map
file_path = Filename("\\Cadtools\cadtools\UKMEA BIM Team\Working Area\Global Revit Standards\02 Templates\01 Existing Arup Templates\ViewColorCheck\viewOverrides.xlsx")
code_block = CodeBlock { "70 - Sh - CS"; }
code_block_2 = CodeBlock { 0; }
code_block_3 = CodeBlock { ["Filter Name", "Visibility", "Pattern Style", "Pattern Color"]; }
code_block_4 = CodeBlock(a=views) { [a]; }
python_script = Python(IN[0]=code_block_4)
# ---------- python_script.python (53 lines) ----------
import clr
clr.AddReference('RevitAPI')
from Autodesk.Revit.DB import *

clr.AddReference("RevitServices")
import RevitServices
from RevitServices.Persistence import DocumentManager

doc = DocumentManager.Instance.CurrentDBDocument
views = UnwrapElement(IN[0])
elementlist = list()

collector = FilteredElementCollector(doc)
filters = collector.OfClass(FilterElement).ToElements()
viewNameList = list()
filterList = []
filterIdList = []
filterEntities = []
filtersHidden = []
filterOverrides = []

for view in views:
	try:
		viewNameList.append(view.Name)
		thisfilter = False
		for filter in filters:
			if view.IsFilterApplied(filter.Id):
				thisfilter = True
				filterList.append(filter.Name)
				filterIdList.append(filter.Id)
				filterEntities.append(filter)
				filtersHidden.append(view.GetFilterVisibility(filter.Id))
				filterOverrides.append(view.GetFilterOverrides(filter.Id))
		if thisfilter:
			elementlist.append(True)
		else:
			elementlist.append(False)
	except:
		elementlist.append(False)
		
patternColor = []
patternStyle = []

for o in filterOverrides:
	colors = o.ProjectionFillColor
	try:
		patternColor.append(colors.Red.ToString() + " " + colors.Green.ToString() + " " + colors.Blue.ToString())
		patternStyle.append(o.ProjectionFillPatternId)
	except:
		patternColor.append("255 255 255")
		patternStyle.append("No Override")
		
OUT = viewNameList, filterList, filtersHidden, patternStyle, patternColor
# ----------------------------------------
deconstruct = List.Deconstruct(list=python_script)
addItemToFront = List.AddItemToFront(item=code_block_3, list=deconstruct.rest, lacing=Longest)
transpose = List.Transpose(lists=addItemToFront)
code_block_5 = CodeBlock { 1; }
exportExcel = Data.ExportExcel(filePath=file_path, sheetName=code_block, startRow=code_block_2, startCol=code_block_2, data=transpose, overWrite=code_block_5)
applyViewTemplate = Custom[View.ApplyViewTemplate]()  # Applies a view template to any given view(s). Supply a string with a view template name.; unwired: Views, View_Template_Name
python_script_2 = Python(IN[0]=python_script)
# ---------- python_script_2.python (21 lines) ----------
import clr
clr.AddReference('RevitAPI')
from Autodesk.Revit.DB import *

clr.AddReference("RevitServices")
import RevitServices
from RevitServices.Persistence import DocumentManager

doc = DocumentManager.Instance.CurrentDBDocument
overrides = UnwrapElement(IN[0])[4]

patternColor = []

for o in overrides:
	colors = o.ProjectionFillColor
	try:
		patternColor.append(colors.Red.ToString() + " " + colors.Green.ToString() + " " + colors.Blue.ToString())
	except:
		patternColor.append("no Override")

OUT = patternColor
# ----------------------------------------
fill_patterns = FillPatterns(index=18)
