# Dynamo graph gridIntersections.dyn (Dynamo 2.0.2.6826)

# group: VerticalGrids
# note: Custom Node: Revit
select_model_elements = DSModelElementsSelection()  # 8 picked in the model; graph input

# group: HorizontalGrids
# note: Custom Node: Revit
select_model_elements_2 = DSModelElementsSelection()  # 8 picked in the model; graph input

categories = Categories(index=231)
all_elements_of_category = ElementsOfCategory(Category=categories)
curve = Grid.Curve(grid=all_elements_of_category)
direction = Line.Direction(line=curve)
XAxis = Vector.XAxis()
isParallel = Vector.IsParallel(vector=direction, other=XAxis)
filterByBoolMask = List.FilterByBoolMask(list=all_elements_of_category, mask=isParallel)
curve_2 = Grid.Curve(grid=filterByBoolMask.in)
curve_3 = Grid.Curve(grid=filterByBoolMask.out)
intersect = Geometry.Intersect(geometry=curve_2@L1, other=curve_3)
flatten = List.Flatten(list=intersect@L3)
family_types = FamilyTypes(index=4)
flatten_2 = List.Flatten(list=intersect)
levels = Levels(index=3)
byPointAndLevel = FamilyInstance.ByPointAndLevel(familyType=family_types, point=flatten_2, level=levels)
# note: Custom Node: Revit
name = Element.Name(element=filterByBoolMask.in)
name_2 = Element.Name(element=filterByBoolMask.out)

# group: create grid intersection points
python_script = Python(IN[0]=flatten_2, IN[1]=name, IN[2]=name_2)
# ---------- python_script.python (27 lines) ----------
import clr

#The inputs to this node will be stored as a list in the IN variables.
class GridPoint():
	def __init__(self):
		self.Point = None
		self.Name = None
		self.vGrid = None
		self.hGrid = None
		pass

gridObjects= []

for vGrid in IN[1]:
	for hGrid in IN[2]:
		instance = GridPoint()
		instance.Name = vGrid+"-"+hGrid
		instance.vGrid = vGrid
		instance.hGrid = hGrid
		gridObjects.append(instance)

for g,p in zip(gridObjects, IN[0]):
	g.Point = p


#Assign your output to the OUT variable.
OUT = [g.Name for g in gridObjects]
# ----------------------------------------

isEmpty = List.IsEmpty(list=intersect@@L2)
flatten_3 = List.Flatten(list=isEmpty)
filterByBoolMask_2 = List.FilterByBoolMask(list=python_script, mask=flatten_3)
code_block = CodeBlock(a=byPointAndLevel, b=filterByBoolMask_2.out) { Elements.Element.SetParameterByName(a, "Summary", b); }
python_script_2 = Python(IN[0]=all_elements_of_category)
# ---------- python_script_2.python (34 lines) ----------
import clr

clr.AddReference('RevitAPI')
from Autodesk.Revit.DB import *
from Autodesk.Revit.DB.Structure import *

clr.AddReference('RevitAPIUI')
from Autodesk.Revit.UI import *

clr.AddReference('System')
from System.Collections.Generic import List

clr.AddReference('RevitNodes')
import Revit
clr.ImportExtensions(Revit.GeometryConversion)
clr.ImportExtensions(Revit.Elements)

clr.AddReference('RevitServices')
import RevitServices
from RevitServices.Persistence import DocumentManager
from RevitServices.Transactions import TransactionManager

doc = DocumentManager.Instance.CurrentDBDocument
uidoc=DocumentManager.Instance.CurrentUIApplication.ActiveUIDocument

#Preparing input from dynamo to revit
element = UnwrapElement(IN[0])

#Do some action in a Transaction
TransactionManager.Instance.EnsureInTransaction(doc)

TransactionManager.Instance.TransactionTaskDone()

OUT = [g.Curve.Direction for g in element]
# ----------------------------------------
