# Dynamo graph gsa9.dyn (Dynamo 1.3.1.1736)

file_path = Filename("C:\Program Files\Oasys\GSA 9.0\Samples\Steel\Steel_Design_Complex.gwb")
openGsaFile = ReadGsa.Core.OpenGsaFile(file_path)
code_block = CodeBlock { "HIGHEST, NODE"; }
code_block_2 = CodeBlock { 0; }
gwaCommand = ReadGsa.Core.GwaCommand(openGsaFile, code_block, code_block_2)
code_block_3 = CodeBlock(A=gwaCommand) { 0..A; }
nodesFromRefs = ReadGsa.GSANodes.NodesFromRefs(openGsaFile, code_block_3)
code_block_4 = CodeBlock { "all"; }
elements = ReadGsa.GSAElements.Elements(openGsaFile, code_block_4)
nodesFromRefs_2 = ReadGsa.GSANodes.NodesFromRefs(openGsaFile, elements.out1)
code_block_5 = CodeBlock { 0; }
getItemAtIndex = List.GetItemAtIndex(list=nodesFromRefs_2.out1, index=code_block_5, lacing=Longest)
code_block_6 = CodeBlock { 1; }
getItemAtIndex_2 = List.GetItemAtIndex(list=nodesFromRefs_2.out1, index=code_block_6, lacing=Longest)
byStartPointEndPoint = Line.ByStartPointEndPoint(startPoint=getItemAtIndex, endPoint=getItemAtIndex_2)
levels = Levels("00")
structural_framing_types = StructuralFramingTypes("SHS150x150x10")
beamByCurve = StructuralFraming.BeamByCurve(curve=byStartPointEndPoint, level=levels, structuralFramingType=structural_framing_types)
code_block_7 = CodeBlock(a=elements.out1) { a; }
flatten = Flatten(code_block_7)
uniqueItems = List.UniqueItems(flatten)
nodeDisplacements = ReadGsa.Analysis.NodeDisplacements(openGsaFile, uniqueItems)
code_block_8 = CodeBlock { 5; }
getItemAtIndex_3 = List.GetItemAtIndex(list=nodeDisplacements, index=code_block_8, lacing=Longest)
code_block_9 = CodeBlock { 442..800; }
elementsOutputs = ReadGsa.GSAElements.ElementsOutputs(arg1=code_block_9)  # unwired: arg0
code_block_10 = CodeBlock(a=elementsOutputs) { a[0][0]; }
code_block_11 = CodeBlock { "all"; }
code_block_12 = CodeBlock { "1"; }
code_block_13 = CodeBlock { 0; }
elementStresses = ReadGsa.Analysis.ElementStresses(openGsaFile, code_block_11, code_block_12, code_block_13)
code_block_14 = CodeBlock { 3; }
beamAllResults = ReadGsa.Analysis.BeamAllResults(openGsaFile, code_block_11, code_block_12, code_block_14, code_block_13)
