# Dynamo graph hideElementInViews.dyn (Dynamo 1.3.1.1736)

# group: select the element to hide in Revit
select_model_elements = DSModelElementsSelection()  # 1 picked in the model

# group: Choose the view where the element will be hidden
list_all_views = Custom[List All Views]()  # not including sheets
get_revit_activeview = Custom[Get Revit ActiveView]()  # Active View
name = Element.Name(get_revit_activeview)
name_2 = Element.Name(list_all_views)
eq = name == name_2
# note: out = all the views excluding the Active View
filterByBoolMask = List.FilterByBoolMask(list=list_all_views, mask=eq)

boolean = BoolSelector(true)
# note: from Archi-lab_Grimshaw
hideElements = Custom[View.HideElements](Element=select_model_elements, View=filterByBoolMask.out, RunIt=boolean)  # This node will hide elements in specified view.

# group: or from menu
views = Views("Section 1")

name_3 = Element.Name(select_model_elements)
