# Dynamo graph lineBeamsIntersection.dyn (Dynamo 2.0.1.5055)

# group: beams
boolean = BoolSelector(false)
python_script = Python(IN[0]=boolean)
# ---------- python_script.python (38 lines) ----------
import clr

clr.AddReference("RevitAPIUI")
from Autodesk.Revit.UI import IExternalEventHandler, ExternalEvent, TaskDialog
from Autodesk.Revit.UI.Selection import *

clr.AddReference("RevitAPI")
from Autodesk.Revit.DB import Transaction, OverrideGraphicSettings, ElementId, Color
# noinspection PyUnresolvedReferences
from Autodesk.Revit.Exceptions import InvalidOperationException


clr.AddReference('RevitServices')
from RevitServices.Persistence import DocumentManager


global result



doc = DocumentManager.Instance.CurrentDBDocument
uidoc = DocumentManager.Instance.CurrentUIApplication.ActiveUIDocument


class CustomISelectionFilter(ISelectionFilter):
	def __init__(self, category_name):
		self.category_name = category_name
	def AllowElement(self, e):
		if e.Category.Name == self.category_name:
			return True
		else:
			return False
	def AllowReference(self, ref, point):
		return false

ref = uidoc.Selection.PickObjects(ObjectType.Element, CustomISelectionFilter("Structural Framing"), "Select Multiple Beams")

OUT = [doc.GetElement(r) for r in ref]
# ----------------------------------------

boolean_2 = BoolSelector(false)
python_script_2 = Python(IN[0]=boolean_2)
# ---------- python_script_2.python (38 lines) ----------
import clr

clr.AddReference("RevitAPIUI")
from Autodesk.Revit.UI import IExternalEventHandler, ExternalEvent, TaskDialog
from Autodesk.Revit.UI.Selection import *

clr.AddReference("RevitAPI")
from Autodesk.Revit.DB import Transaction, OverrideGraphicSettings, ElementId, Color
# noinspection PyUnresolvedReferences
from Autodesk.Revit.Exceptions import InvalidOperationException


clr.AddReference('RevitServices')
from RevitServices.Persistence import DocumentManager


global result



doc = DocumentManager.Instance.CurrentDBDocument
uidoc = DocumentManager.Instance.CurrentUIApplication.ActiveUIDocument


class CustomISelectionFilter(ISelectionFilter):
	def __init__(self, category_name):
		self.category_name = category_name
	def AllowElement(self, e):
		if e.Category.Name == self.category_name:
			return True
		else:
			return False
	def AllowReference(self, ref, point):
		return false

ref = uidoc.Selection.PickObjects(ObjectType.Element, CustomISelectionFilter("Lines"), "Select Lines")

OUT = [doc.GetElement(r) for r in ref]
# ----------------------------------------
python_script_3 = Python(IN[0]=python_script, IN[1]=python_script_2)
# ---------- python_script_3.python (39 lines) ----------
# Enable Python support and load DesignScript library
import clr
clr.AddReference('ProtoGeometry')
from Autodesk.DesignScript.Geometry import *

import clr
clr.AddReference("RevitNodes")
import Revit
# Import ToProtoType, ToRevitType geometry conversion extension methods
clr.ImportExtensions(Revit.GeometryConversion)


def distance(st, end):
	return ((end.X-st.X)**2+(end.Y-st.Y)**2)**0.5

beams = UnwrapElement(IN[0])
penoLine = UnwrapElement(IN[1])

result = []

for b in beams:
	subList = [b]
	result.append(subList)
	beamCrv = b.Location.Curve.ToProtoType()
	beamStPt = beamCrv.PointAtParameter(0)
	for p in penoLine:
		crv = p.Location.Curve.ToProtoType()		
		intPt = Geometry.Intersect(beamCrv, crv)		
		if intPt:			
			dist = distance(intPt[0], beamStPt)
			subList.append(p.LineStyle.Name)
			subList.append(intPt[0])
			#subList.append(beamStPt)
			subList.append(dist)
		else:
			continue

# Assign your output to the OUT variable.
OUT = result
# ----------------------------------------
