# Dynamo graph listFilter.dyn (Dynamo 1.3.2.2480)

categories = Categories("StructuralColumns")
all_elements_of_category = ElementsOfCategory(categories)
code_block = CodeBlock { "GSA Section Reference"; }
getParameterValueByName = Element.GetParameterValueByName(element=all_elements_of_category, parameterName=code_block)
type = Object.Type(getParameterValueByName)
code_block_2 = CodeBlock { "4"; }
eq = getParameterValueByName == code_block_2
filterByBoolMask = List.FilterByBoolMask(list=all_elements_of_category, mask=eq)

# group: lacing set to longest
code_block_3 = CodeBlock { "4"; }
containsItem = List.ContainsItem(list=getParameterValueByName, item=code_block_3, lacing=Longest)

code_block_4 = CodeBlock { "4"; }
contains = String.Contains(str=getParameterValueByName, searchFor=code_block_4)
