# Dynamo graph loft.dyn (Dynamo 1.3.3.4651)

select_model_element = DSModelElementSelection()
geometry = Element.Geometry(select_model_element)
planeAtParameter = Curve.PlaneAtParameter(curve=geometry)
byPlaneRadius = Circle.ByPlaneRadius(plane=planeAtParameter)
curves = PolyCurve.Curves(geometry)
byLoft = Solid.ByLoft(byPlaneRadius, curves)
