# Dynamo graph loop.dyn (Dynamo 2.0.0.3911)

code_block = CodeBlock { {1..5}; }
python_script = Python(IN[0]=code_block)
# ---------- python_script.python (9 lines) ----------
import clr
clr.AddReference('ProtoGeometry')
from Autodesk.DesignScript.Geometry import *
a = IN[0]

if len(a)>1:
	OUT = "ciao"
else:
	OUT = "beta"
# ----------------------------------------
code_block_2 = CodeBlock { {{1..5,6..8,5..9},{4..8}}; }
python_script_2 = Python(IN[0]=code_block_2)
# ---------- python_script_2.python (13 lines) ----------
import clr
clr.AddReference('ProtoGeometry')
from Autodesk.DesignScript.Geometry import *
#The inputs to this node will be stored as a list in the IN variables.
lista = IN[0]
newLista = lista

for i in range(0,len(lista)):
	for j in range(0,len(lista[i])):
		newLista[i][j].append(lista[i][j][0])
		
#Assign your output to the OUT variable.
OUT = newLista
# ----------------------------------------
python_script_3 = Python(IN[0]=python_script_2)
# ---------- python_script_3.python (19 lines) ----------
import clr
clr.AddReference('ProtoGeometry')
from Autodesk.DesignScript.Geometry import *
#The inputs to this node will be stored as a list in the IN variables.
lista = IN[0]

oP = []
iP = []

for i in range(0,len(lista)):
		if len(lista[i])>1:
			oP.append(lista[i][0])
			for j in range(1,len(lista[i])):
				iP.append(lista[i][j])
		else:
			oP.append(lista[i][0])

#Assign your output to the OUT variable.
OUT = oP, iP
# ----------------------------------------
python_script_4 = Python(IN[0]=python_script_2)
# ---------- python_script_4.python (13 lines) ----------
import clr
clr.AddReference('ProtoGeometry')
from Autodesk.DesignScript.Geometry import *
#The inputs to this node will be stored as a list in the IN variables.
lista = IN[0]

oP = []
iP = []

for i in range(0,len(lista)):
	oP.append(len(lista[i]))
#Assign your output to the OUT variable.
OUT = oP
# ----------------------------------------
