# Dynamo graph mapExcel.dyn (Dynamo 1.3.1.1736)

file_path = Filename("C:\Users\giovanni.brogiolo\Desktop\HC.xlsx")
fromPath = FileObject(file_path)  # "File.FromPath"
code_block = CodeBlock { "Sheet1"; }
code_block_2 = CodeBlock { true; }
readFromFile = Excel.ReadFromFile(file=fromPath, sheetName=code_block, readAsStrings=code_block_2)
code_block_3 = CodeBlock { 0; }
clean = List.Clean(list=readFromFile, preserveIndices=code_block_3)
transpose = List.Transpose(clean)
code_block_4 = CodeBlock(a=transpose) { a[0]; }
categories = Categories("MEPSpaces")
all_elements_of_category = ElementsOfCategory(categories)
code_block_5 = CodeBlock { "Number"; }
getParameterValueByName = Element.GetParameterValueByName(element=all_elements_of_category, parameterName=code_block_5)
allIndicesOf = List.AllIndicesOf(list=code_block_4, item=getParameterValueByName)
getItemAtIndex = List.GetItemAtIndex(list=transpose, index=allIndicesOf, lacing=CrossProduct)
flatten = Flatten(getItemAtIndex@L3)
