# Dynamo graph minimumDistDef.dyn (Dynamo 1.3.2.2480)

python_script = Python()  # unwired: IN[0]; starter script, not edited (OUT = 0)
code_block = CodeBlock { Point.ByCoordinates(0,0,0); }
code_block_2 = CodeBlock { 0; 1000; 100; 1; }
randomNumbers = Lists.Sequence.RandomNumbers(code_block_2.out0, code_block_2.out1, code_block_2.out2, code_block_2.out3)
byCoordinates = Point.ByCoordinates(x=randomNumbers, y=randomNumbers, lacing=CrossProduct)
flatten = Flatten(byCoordinates)

# group: 2 points
python_script_2 = Python(IN[0]=code_block, IN[1]=flatten)
# ---------- python_script_2.python (15 lines) ----------
import clr
clr.AddReference('ProtoGeometry')
from Autodesk.DesignScript.Geometry import *

import math

def dist(p1, p2):
    return math.sqrt((p1.X - p2.X) ** 2 + (p1.Y - p2.Y) ** 2)

distances = [dist(IN[0],p) for p in IN[1]]



#Assign your output to the OUT variable.
OUT = IN[1][distances.index(min(distances))]
# ----------------------------------------

python_script_3 = Python()  # unwired: IN[0]; starter script, not edited (OUT = 0)
closestTo = Custom[Geometry.ClosestTo]()  # Finds the closest entity in a list of geometric entities from another given entity; unwired: geometry, other
code_block_3 = CodeBlock { Point.ByCoordinates(50,0,0); }
code_block_4 = CodeBlock(a=code_block, b=code_block_3) { {a,b}; }

# group: 2 points to 1 list of points
python_script_4 = Python(IN[0]=code_block_4, IN[1]=flatten)
# ---------- python_script_4.python (15 lines) ----------
import clr
clr.AddReference('ProtoGeometry')
from Autodesk.DesignScript.Geometry import *

import math

def dist(p1, pts):
	distances = [math.sqrt((p1.X - p.X) ** 2 + (p1.Y - p.Y) ** 2) for p in pts]
	return pts[distances.index(min(distances))]




#Assign your output to the OUT variable.
OUT = [dist(d,IN[1]) for d in IN[0]]
# ----------------------------------------

# group: 2 points to 1 list of points with for loop
python_script_5 = Python(IN[0]=code_block_4, IN[1]=flatten)
# ---------- python_script_5.python (18 lines) ----------
import clr
clr.AddReference('ProtoGeometry')
from Autodesk.DesignScript.Geometry import *

import math


cp = []
for d in IN[0]:
	distances = []
	for p in IN[1]:
		distances.append(math.sqrt((d.X - p.X) ** 2 + (d.Y - p.Y) ** 2))
	cp.append(IN[1][distances.index(min(distances))])



#Assign your output to the OUT variable.
OUT = cp
# ----------------------------------------

flatten_2 = Flatten(byCoordinates)
code_block_5 = CodeBlock(a=flatten, b=flatten_2) { {a,b}; }
python_script_6 = Python(IN[0]=code_block_4, IN[1]=code_block_5)
# ---------- python_script_6.python (18 lines) ----------
import clr
clr.AddReference('ProtoGeometry')
from Autodesk.DesignScript.Geometry import *

import math

def dist(p1, pts):
	distances = [math.sqrt((p1.X - p.X) ** 2 + (p1.Y - p.Y) ** 2) for p in pts]
	return pts[distances.index(min(distances))]

cp = []

for d in IN[0]:
	for p in IN[1]:
		cp.append(dist(d,p))

#Assign your output to the OUT variable.
OUT = cp
# ----------------------------------------
python_script_7 = Python(IN[0]=code_block_4, IN[1]=code_block_5)
# ---------- python_script_7.python (19 lines) ----------
import clr
clr.AddReference('ProtoGeometry')
from Autodesk.DesignScript.Geometry import *

import math


cp = []
for d in IN[0]:
	for p in IN[1]:
		distances = []
		for q in p:
			distances.append(math.sqrt((d.X - q.X) ** 2 + (d.Y - q.Y) ** 2))
		cp.append(p[distances.index(min(distances))])



#Assign your output to the OUT variable.
OUT = cp
# ----------------------------------------
