# Dynamo graph modifyFilters01.dyn (Dynamo 1.3.1.1736)

current = Document.Current()
activeView = Document.ActiveView(current)
resetOverridesInView = Custom[Element.ResetOverridesInView](view=activeView)  # Resets all overrides for an element in a given view; unwired: element
all_elements_in_active_view = ElementsInView()
current_2 = Document.Current()
activeView_2 = Document.ActiveView(current_2)
code_block = CodeBlock { "Weeks before actual"; }
code_block_2 = CodeBlock { "Actual Week"; }
code_block_3 = CodeBlock { "Future Works"; }
create = List.Create(code_block, code_block_2, code_block_3)
all_elements_in_active_view_2 = ElementsInView()
name = Category.Name(all_elements_in_active_view_2)
code_block_4 = CodeBlock { ""; }
code_block_5 = CodeBlock(a=name, b=code_block_4) { a==b; }
filterByBoolMask = List.FilterByBoolMask(list=all_elements_in_active_view_2, mask=code_block_5)
getCategory = Element.GetCategory(filterByBoolMask.out)
select_rule_type = RuleTypes("Less")
select_rule_type_2 = RuleTypes("Equals")
select_rule_type_3 = RuleTypes("Greater")
code_block_6 = CodeBlock(a=select_rule_type, b=select_rule_type_2, c=select_rule_type_3) { {{a},{b},{c}}; }

# group: Actual Week
code_block_7 = CodeBlock { "3"; }

code_block_8 = CodeBlock { "Comments"; }
parameterByName = Parameter.ParameterByName(element=filterByBoolMask.out, name=code_block_8)
code_block_9 = CodeBlock(a=parameterByName) { a[0]; }
byRuleType = Revit.Filter.FilterRule.ByRuleType(code_block_6, code_block_7, code_block_9, lacing=Longest)
byRules = Revit.Filter.ParameterFilterElement.ByRules(create, getCategory, byRuleType)
addFilter = View.AddFilter(activeView_2, byRules)
green = Custom[Color.Green]()  # Returns the colour green.
red = Custom[Color.Red]()  # Returns the colour red.
blue = Custom[Color.Blue]()  # Returns the colour blue.
code_block_10 = CodeBlock(a=green, b=red, c=blue) { {a,b,c}; }
fill_patterns = FillPatterns("Solid fill")
code_block_11 = CodeBlock { {0,0,50}; }
byProperties = Revit.Filter.OverrideGraphicSettings.ByProperties(arg1=code_block_10, arg5=fill_patterns, arg10=code_block_11)

# group: Shoe/Hide filters
code_block_12 = CodeBlock { {true, true, true}; }

setFilterOverrides = View.SetFilterOverrides(view=addFilter, parameterFilter=byRules, overrides=byProperties, hide=code_block_12)
code_block_13 = CodeBlock(a=setFilterOverrides) { a[0]; }
passthrough = Custom[Passthrough](passThrough=code_block_13, waitFor=setFilterOverrides)  # Forces a sequential order of execution. The node wired into the output of the Passthrough node will be executed *after* the node wired into the waitFor input (e.g. important for some Revit operations). The value of the passThrough input will be passed on to the node wired into the output port of the Passthrough node.
string = StringInput("C:\Users\giovanni.brogiolo\Documents\gwc\")
code_block_14 = CodeBlock(a=string, b=code_block_7) { a+b+".jpg"; }
exportAsImage = View.ExportAsImage(passthrough, code_block_14)
code_block_15 = CodeBlock { 1..100; }
string_from_object = FromObject(code_block_15)
boolean = BoolSelector(false)
code_block_16 = CodeBlock { 1; }
step = Core.Counter.Step(boolean, code_block_16)
count = Core.Counter.Count(step)
getItemAtIndex = List.GetItemAtIndex(list=string_from_object, index=count)
python_script = Python()  # unwired: IN[0]
# ---------- python_script.python (50 lines) ----------
import clr
clr.AddReference('ProtoGeometry')
from Autodesk.DesignScript.Geometry import *


# Import DocumentManager and TransactionManager
clr.AddReference("RevitServices")
import RevitServices
from RevitServices.Persistence import DocumentManager
from RevitServices.Transactions import TransactionManager


# Import RevitAPI
clr.AddReference("RevitAPI")
import Autodesk
from Autodesk.Revit.DB import *


doc = DocumentManager.Instance.CurrentDBDocument
uiapp = DocumentManager.Instance.CurrentUIApplication
app = uiapp.Application


from System.Collections.Generic import *


# Import ToDSType(bool) extension method
clr.AddReference("RevitNodes")
import Revit
clr.ImportExtensions(Revit.Elements)

refschedule = UnwrapElement(IN[0])
tgtschedules = UnwrapElement(IN[1])
tgtstrings = IN[2]

refdefinition = refschedule.Definition
reffilter = refdefinition.GetFilter(0)

TransactionManager.Instance.EnsureInTransaction(doc)

for tgtstring in tgtstrings
	tgtfilter = reffilter.SetValue(tgtstring)

for tgtschedule in tgtschedules:
	tgtdefinition = tgtschedule.Definition
	tgtdefinition.InsertFilter(reffilter, 0)

TransactionManager.Instance.TransactionTaskDone()

OUT = tgtschedules
# ----------------------------------------
get_all_filter = Custom[Get All Filter]()  # Get all Filter
code_block_17 = CodeBlock { "Test"; }
indexOf = IndexOf(get_all_filter.Name, code_block_17)
getItemAtIndex_2 = List.GetItemAtIndex(list=get_all_filter.Element, index=indexOf)
name_2 = Element.Name(getItemAtIndex_2)
code_block_18 = CodeBlock { "ventire"; }
python_script_2 = Python(IN[0]=getItemAtIndex_2, IN[1]=code_block_18)
# ---------- python_script_2.python (59 lines) ----------
import clr
clr.AddReference('ProtoGeometry')
from Autodesk.DesignScript.Geometry import *


# Import DocumentManager and TransactionManager
clr.AddReference("RevitServices")
import RevitServices
from RevitServices.Persistence import DocumentManager
from RevitServices.Transactions import TransactionManager


# Import RevitAPI
clr.AddReference("RevitAPI")
import Autodesk
from Autodesk.Revit.DB import *


doc = DocumentManager.Instance.CurrentDBDocument
uiapp = DocumentManager.Instance.CurrentUIApplication
app = uiapp.Application


from System.Collections.Generic import *


# Import ToDSType(bool) extension method
clr.AddReference("RevitNodes")
import Revit
clr.ImportExtensions(Revit.Elements)

filterElement = UnwrapElement(IN[0])

setValue = IN[1]

categories = List[Autodesk.Revit.DB.ElementId]()

categories.Add(ElementId(BuiltInCategory.OST_Walls))

parameterCollector = FilteredElementCollector(doc)

#parameter = parameterCollector.OfClass(typeof(Autodesk.Revit.DB.Wall)).FirstElement().get_Parameter("Comments")

comment_param = BuiltInParameter.ALL_MODEL_INSTANCE_COMMENTS

parameter = Autodesk.Revit.DB.FilteredElementCollector(DocumentManager.Instance.CurrentDBDocument).OfClass(clr.GetClrType(Wall)).FirstElement().get_Parameter(comment_param)

filterRules = List[Autodesk.Revit.DB.FilterRule]()

filterRules.Add(ParameterFilterRuleFactory.CreateEqualsRule(parameter.Id, setValue, True));

TransactionManager.Instance.EnsureInTransaction(doc)

#filterElement.ClearRules()
filterElement.SetRules(filterRules);
 
TransactionManager.Instance.TransactionTaskDone()

OUT = categories, parameter
# ----------------------------------------
code_block_19 = CodeBlock { "Actual Week"; }
indexOf_2 = IndexOf(get_all_filter.Name, code_block_19)
getItemAtIndex_3 = List.GetItemAtIndex(list=get_all_filter.Element, index=indexOf_2)
select_rule_type_4 = RuleTypes("Equals")
code_block_20 = CodeBlock { "50"; }
byRuleType_2 = Revit.Filter.FilterRule.ByRuleType(select_rule_type_4, code_block_20, code_block_9)
python_script_3 = Python(IN[0]=getItemAtIndex_3, IN[1]=byRuleType_2)
# ---------- python_script_3.python (46 lines) ----------
import clr
clr.AddReference('ProtoGeometry')
from Autodesk.DesignScript.Geometry import *


# Import DocumentManager and TransactionManager
clr.AddReference("RevitServices")
import RevitServices
from RevitServices.Persistence import DocumentManager
from RevitServices.Transactions import TransactionManager


# Import RevitAPI
clr.AddReference("RevitAPI")
import Autodesk
from Autodesk.Revit.DB import *


doc = DocumentManager.Instance.CurrentDBDocument
uiapp = DocumentManager.Instance.CurrentUIApplication
app = uiapp.Application


from System.Collections.Generic import *


# Import ToDSType(bool) extension method
clr.AddReference("RevitNodes")
import Revit
clr.ImportExtensions(Revit.Elements)

filterElement = UnwrapElement(IN[0])
rules = UnwrapElement(IN[1])



TransactionManager.Instance.EnsureInTransaction(doc)

#filterElement.ClearRules()
role = filterElement.GetRules()



TransactionManager.Instance.TransactionTaskDone()

OUT = role
# ----------------------------------------
create_view_filter = Custom[Create View Filter]()  # uses Contains rule; unwired: categories, builtInParameterName, equalsValue, newFilterName
python_script_4 = Python()  # unwired: IN[0], IN[1], IN[2], IN[3]
# ---------- python_script_4.python (58 lines) ----------
#from the forum originally
import clr

clr.AddReference("RevitServices")
import RevitServices
from RevitServices.Persistence import DocumentManager
from RevitServices.Transactions import TransactionManager

doc = DocumentManager.Instance.CurrentDBDocument

clr.AddReference("RevitAPI")
import Autodesk
from Autodesk.Revit.DB import *
import System
from System.Collections.Generic import *

dataEnteringNode = IN

def GetBuiltInParam(paramName):
	builtInParams = System.Enum.GetValues(BuiltInParameter)
	test = []
	for i in builtInParams:
		if i.ToString() == paramName:
			test.append(i)
			break
		else:
			continue
	return test [0]

cats = IN[0]
paramName = IN[1]
pValue = IN[2]
filName = IN[3]
#clearRules = IN[4]
#view = UnwrapElement(IN[4])

TransactionManager.Instance.EnsureInTransaction(doc)

catList = []
for i in cats:
	catList.append(ElementId(i.Id))

typedCatList = List[ElementId](catList)

bip = GetBuiltInParam(paramName)

rules = []

rules.append(ParameterFilterRuleFactory.CreateContainsRule(ElementId(bip), pValue, 0.001))

try:
	filter = ParameterFilterElement.Create(doc, filName, typedCatList, rules)
except:
	filter = "Sorry, failed. Please check that you have a unique filter name."

TransactionManager.Instance.TransactionTaskDone()

OUT = filter
# ----------------------------------------
code_block_21 = CodeBlock(a=code_block_9) { a; }
id = Element.Id(parameterByName)
getBuiltInParamterName = Archilab.Grimshaw.Elements.Parameter.GetBuiltInParamterName(filterByBoolMask.out, code_block_8)
