# Dynamo graph moveTendosStartPoint.dyn (Dynamo 1.3.3.4651)

# group: Tendons
select_model_elements = DSModelElementsSelection()  # 4 picked in the model

getLocation = Element.GetLocation(select_model_elements)
startPoint = Curve.StartPoint(getLocation)

# group: Distance
code_block = CodeBlock { 840; }

translate = Geometry.Translate(geometry=startPoint, xTranslation=code_block)
endPoint = Curve.EndPoint(getLocation)
byStartPointEndPoint = Line.ByStartPointEndPoint(startPoint=translate, endPoint=endPoint)
setLocation = Element.SetLocation(select_model_elements, byStartPointEndPoint)
