# Dynamo graph parBurst02.dyn (Dynamo 1.3.2.2480)

code_block = CodeBlock { 0..7; }
code_block_2 = CodeBlock { 0..12; }
byCoordinates = Point.ByCoordinates(x=code_block, y=code_block_2, lacing=CrossProduct)
