# Dynamo graph parameterExists.dyn (Dynamo 1.3.1.1736)

select_model_elements = DSModelElementsSelection()  # 6 picked in the model
code_block = CodeBlock { "Type"; }
getParameterValueByName = Element.GetParameterValueByName(element=select_model_elements, parameterName=code_block, lacing=CrossProduct)
code_block_2 = CodeBlock { {"tfb","tf","t"}; }
getParameterValueByName_2 = Element.GetParameterValueByName(element=getParameterValueByName, parameterName=code_block_2, lacing=CrossProduct)
code_block_3 = CodeBlock { 0; }
gt = getParameterValueByName_2 > code_block_3
isNull = Object.IsNull(gt)
flatten = Flatten(isNull@L3)
transpose = List.Transpose(flatten)
boolean = BoolSelector(false)
allIndicesOf = List.AllIndicesOf(list=transpose, item=boolean, lacing=Longest)

# group: instances
getItemAtIndex = List.GetItemAtIndex(list=select_model_elements, index=allIndicesOf)

flatten_2 = Flatten(getParameterValueByName)

# group: types
getItemAtIndex_2 = List.GetItemAtIndex(list=flatten_2, index=allIndicesOf)

getParameterValueByName_3 = Element.GetParameterValueByName(element=getItemAtIndex_2, parameterName=code_block_2)
code_block_4 = CodeBlock { {5,10,20}; }
add = getParameterValueByName_3 + code_block_4  # lacing=Longest
setParameterByName = Element.SetParameterByName(element=getItemAtIndex, value=add, lacing=Longest)  # unwired: parameterName
code_block_5 = CodeBlock { "z Offset Value"; }
select_model_elements_2 = DSModelElementsSelection()  # 6 picked in the model
code_block_6 = CodeBlock { "z Offset Value"; }
code_block_7 = CodeBlock { "Type"; }
getParameterValueByName_4 = Element.GetParameterValueByName(element=select_model_elements_2, parameterName=code_block_7, lacing=CrossProduct)
flatten_3 = Flatten(getParameterValueByName_4)
code_block_8 = CodeBlock { {"tfb","tf","t"}; }
parameterByName = Parameter.ParameterByName(element=flatten_3, name=code_block_8, lacing=CrossProduct)
transpose_2 = List.Transpose(parameterByName)
value = Parameter.Value(transpose_2)
code_block_9 = CodeBlock { {5,10,20}; }
add_2 = value + code_block_9  # lacing=Longest
code_block_10 = CodeBlock { {5,10,20}; }
add_3 = add_2 + code_block_10  # lacing=Longest
python_script = Python(IN[0]=add_3)
# ---------- python_script.python (15 lines) ----------
import clr
clr.AddReference('ProtoGeometry')
from Autodesk.DesignScript.Geometry import *
#The inputs to this node will be stored as a list in the IN variables.
data = IN[0]

newData = []

for i in range(0,len(data)):
	for j in range(0,len(data[i])):
		if data[i][j] != None:
			newData.Insert(j,data[i][j])

#Assign your output to the OUT variable.
OUT = newData
# ----------------------------------------
setParameterByName_2 = Element.SetParameterByName(element=select_model_elements_2, parameterName=code_block_6, value=python_script, lacing=Longest)
