# Dynamo graph pipesByLines.dyn (Dynamo 1.3.1.1736)

select_model_elements = DSModelElementsSelection()  # 3 picked in the model
curves = Element.Curves(select_model_elements)
select_model_elements_2 = DSModelElementsSelection()  # 1 picked in the model
getType = WombatDynamo.Element.GetType(select_model_elements_2)
code_block = CodeBlock { "System Type"; }
getParameterValueByName = Element.GetParameterValueByName(element=select_model_elements_2, parameterName=code_block)
levels = Levels("00")
code_block_2 = CodeBlock { {40,50,200}; }
byLines = Custom[Pipe.ByLines](Lines=curves, PipeType=getType, SystemType=getParameterValueByName, Level=levels, Diameter=code_block_2, lacing=Longest)  # Creates a pipe by Line, PipeType, SystemType, Level and Diameter
code_block_3 = CodeBlock { "Diameter"; }
python_script = Python(IN[0]=code_block_2)
# ---------- python_script.python (27 lines) ----------
import clr
clr.AddReference('RevitAPI')
from Autodesk.Revit.DB import *

import clr
clr.AddReference('ProtoGeometry')
from Autodesk.DesignScript.Geometry import *
# Import DocumentManager and TransactionManager
clr.AddReference("RevitServices")
import RevitServices
from RevitServices.Persistence import DocumentManager
doc = DocumentManager.Instance.CurrentDBDocument
# Import RevitAPI
clr.AddReference("RevitAPI")
import Autodesk
from Autodesk.Revit.DB import *


vals = IN[0]

getDocUnits = doc.GetUnits()
getDisplayUnits = getDocUnits.GetFormatOptions(UnitType.UT_Length).DisplayUnits

elementlist = []
for val in vals:
	elementlist.append(UnitUtils.ConvertToInternalUnits(val,getDisplayUnits))
OUT = elementlist
# ----------------------------------------
setParameterByName = Element.SetParameterByName(element=byLines, parameterName=code_block_3, value=python_script)
toInternalUnit = Custom[DisplayUnit.ToInternalUnit]()  # Converts a value from a given display unit to Revit's internal unit; unwired: val, displayUnitType
