# Dynamo graph placeWindows01.dyn (Dynamo 1.3.1.1736)

select_model_element = DSModelElementSelection()  # 1 picked in the model
family_types = FamilyTypes("Window_void:void")

# group: from Bakery
get_loaded_rvt_links = Custom[Get Loaded RVT Links]()

categories = Categories("CurtainWallPanels")

# group: from SteamNodes
getFromLinkedFile = Custom[Element.GetFromLinkedFile](Link_Instance=get_loaded_rvt_links.loaded_Link_Names, Link_Document=get_loaded_rvt_links.loaded_Link_Docs, Category=categories)  # Get elements from link document instance based on category

subComponents = Custom[FamilyInstance.SubComponents](familyInstance=getFromLinkedFile)  # Retrieves all subcomponents of a given family instance
flatten = Flatten(subComponents)
location = FamilyInstance.Location(flatten)
byPoints = Custom[Springs.HostedInstance.ByPoints](host=select_model_element, type=family_types, point=location)  # Creates hosted family instances(doors/windows) at the specified points. You can feed either a single family type or a unique type for each instance.
code_block = CodeBlock { {"Void_Width","Void_height"}; }
code_block_2 = CodeBlock { {"S.O. _ Width","S.O. _ Height"}; }
getParameterValueByName = Element.GetParameterValueByName(element=getFromLinkedFile, parameterName=code_block_2, lacing=CrossProduct)
code_block_3 = CodeBlock { 0; }
round = Math.Round(number=getParameterValueByName, digits=code_block_3)
setParameterByName = Element.SetParameterByName(element=byPoints, parameterName=code_block@L2, value=round, lacing=Longest)

# group: alternative way
levels = Levels("00")
byPointAndLevel = FamilyInstance.ByPointAndLevel(level=levels)  # unwired: familyType, point
select_model_elements = DSModelElementsSelection()
name = Element.Name()  # unwired: arg0
groupByFunction = GroupByFunction(select_model_elements@L1, name)

subComponents_2 = Custom[FamilyInstance.SubComponents](familyInstance=select_model_elements)
flatten_2 = Flatten(subComponents_2)
location_2 = FamilyInstance.Location(flatten_2)
