# Dynamo graph postableCommand.dyn (Dynamo 1.3.1.1736)

boolean = BoolSelector(true)
element_types = ElementTypes("WallType")
all_elements_of_type = ElementsOfType(element_types)
code_block = CodeBlock(a=all_elements_of_type) { a[0]; }
python_script = Python(IN[0]=boolean, IN[1]=code_block)
# ---------- python_script.python (37 lines) ----------
import clr

clr.AddReference("RevitServices")
import RevitServices
from RevitServices.Persistence import DocumentManager
from RevitServices.Transactions import TransactionManager
doc =  DocumentManager.Instance.CurrentDBDocument
uidoc = DocumentManager.Instance.CurrentUIDocument
app = DocumentManager.Instance.CurrentUIApplication.Application
uiapp = DocumentManager.Instance.CurrentUIApplication

clr.AddReference("RevitNodes")
import Revit
clr.ImportExtensions(Revit.Elements)
clr.ImportExtensions(Revit.GeometryConversion)

clr.AddReference("RevitAPI")
from Autodesk.Revit.DB import *
clr.AddReference("RevitAPIUI")
from Autodesk.Revit.UI import *
output = []

pCmd = RevitCommandId.LookupPostableCommandId(PostableCommand.Loads)

alt = UnwrapElement(IN[1])

if IN[0] == True:
	uiapp.PostCommand(pCmd)
	#uidoc.PostRequestForElementTypePlacement(alt)
	#id = RevitCommandId.LookupCommandId("IDR_SKETCH_OBJECTS_AREA_LOAD")
	output = "done"	
	
else :
	output = 'set runit to true'


OUT = output
# ----------------------------------------
code_block_2 = CodeBlock(a=all_elements_of_type) { a; }
