# Dynamo graph pythonCheckBox.dyn (Dynamo 2.0.1.5055)

python_script = Python()  # unwired: IN[0]
# ---------- python_script.python (136 lines) ----------
import clr

clr.AddReference("System.Windows.Forms")
from System.Windows.Forms import Application, Button, Form, Label, TextBox, CheckBox, FolderBrowserDialog, OpenFileDialog, DialogResult, ComboBox, FormBorderStyle, FormStartPosition, CheckedListBox

clr.AddReference("System.Drawing")
from System.Drawing import *

clr.AddReference("System")
from System import EventHandler


collOnSheet = ["Item A", "Item B", "Item C", "Item D"]

def Form1Load(sender, e):
		for s in collOnSheet:
			checkedListBox.Items.Add(s)


def checkAll():
	for i in range (0,checkedListBox1.Items.Count - 1):
		checkedListBox1.SetItemChecked(i, True);

def Button1Click(sender, e):
	checkAll();


def Button2Click(sender, e):
	uncheckAll();


def Button3Click(sender, e):
	itemsChecked();



form = Form()

checkedListBox = CheckedListBox();
button1 = Button();
button2 = Button();
button3 = Button();
checkedListBox1 = CheckedListBox();
label1 = Label();
label2 = Label();
# 
# checkedListBox
# 
checkedListBox.FormattingEnabled = True;
checkedListBox.Location = Point(9, 34);
checkedListBox.Name = "checkedListBox";
checkedListBox.Size = Size(260, 34);
checkedListBox.TabIndex = 0;
checkedListBox.UseCompatibleTextRendering = True;
# 
# button1
# 
button1.Location = Point(398, 74);
button1.Name = "button1";
button1.Size = Size(68, 25);
button1.TabIndex = 1;
button1.Text = "Select All";
button1.UseCompatibleTextRendering = True;
button1.UseVisualStyleBackColor = True;
button1.Click += EventHandler(Button1Click);
# 
# button2
# 
button2.Location = Point(481, 74);
button2.Name = "button2";
button2.Size = Size(76, 25);
button2.TabIndex = 2;
button2.Text = "Unselect All";
button2.UseCompatibleTextRendering = True;
button2.UseVisualStyleBackColor = True;
button2.Click += EventHandler(Button2Click);
# 
# button3
# 
button3.DialogResult = DialogResult.OK;
button3.Location = Point(227, 115);
button3.Name = "button3";
button3.Size = Size(106, 25);
button3.TabIndex = 3;
button3.Text = "Delete Selected";
button3.UseCompatibleTextRendering = True;
button3.UseVisualStyleBackColor = True;
button3.Click += EventHandler(Button3Click);
# 
# checkedListBox1
# 
checkedListBox1.FormattingEnabled = True;
checkedListBox1.Location = Point(297, 34);
checkedListBox1.Name = "checkedListBox1";
checkedListBox1.Size = Size(260, 34);
checkedListBox1.TabIndex = 4;
checkedListBox1.UseCompatibleTextRendering = True;
# 
# label1
# 
label1.Location = Point(12, 16);
label1.Name = "label1";
label1.Size = Size(236, 16);
label1.TabIndex = 5;
label1.Text = "Schedule on sheet";
label1.UseCompatibleTextRendering = True;
# 
# label2
# 
label2.Location = Point(297, 16);
label2.Name = "label2";
label2.Size = Size(224, 16);
label2.TabIndex = 6;
label2.Text = "Schedule not on sheet";
label2.UseCompatibleTextRendering = True;
# 
# Form1
# 
form.ClientSize = Size(567, 152);
form.Controls.Add(label2);
form.Controls.Add(label1);
form.Controls.Add(checkedListBox1);
form.Controls.Add(button3);
form.Controls.Add(button2);
form.Controls.Add(button1);
form.Controls.Add(checkedListBox);
form.Name = "Form1";
form.StartPosition = FormStartPosition.CenterScreen;
form.Text = "Delete selected schedules";
form.Load += EventHandler(Form1Load);


form.ShowDialog()


OUT = 0
# ----------------------------------------
