# Dynamo graph pythonClass.dyn (Dynamo 2.1.0.6255)

categories = Categories(index=447)
all_elements_of_category = ElementsOfCategory(Category=categories)
id = Element.Id(element=all_elements_of_category)
string_from_object = FromObject(obj=id)
byKeysValues = DesignScript.Builtin.Dictionary.ByKeysValues(keys=string_from_object, values=all_elements_of_category)
code_block = CodeBlock { DSCore.List.Flatten("Space "+["A".."F"]); }
byKeysValues_2 = DesignScript.Builtin.Dictionary.ByKeysValues(keys=code_block, values=all_elements_of_category)
python_script = Python(IN[0]=all_elements_of_category)
# ---------- python_script.python (42 lines) ----------
import clr

clr.AddReference('RevitAPI')
from Autodesk.Revit.DB import *
from Autodesk.Revit.DB.Structure import *

clr.AddReference('RevitAPIUI')
from Autodesk.Revit.UI import *

clr.AddReference('System')
from System.Collections.Generic import List

clr.AddReference('RevitNodes')
import Revit
clr.ImportExtensions(Revit.GeometryConversion)
clr.ImportExtensions(Revit.Elements)

clr.AddReference('RevitServices')
import RevitServices
from RevitServices.Persistence import DocumentManager
from RevitServices.Transactions import TransactionManager

doc = DocumentManager.Instance.CurrentDBDocument
uidoc=DocumentManager.Instance.CurrentUIApplication.ActiveUIDocument

#Preparing input from dynamo to revit
element = UnwrapElement(IN[0])


class Space:
	pass

mySpaceList = []

for e in element:
	mySpace = Space()
	mySpace.Id = e.Id
	mySpace.Name = "Space " + e.GetParameters("Number")[0].AsString()
	mySpace.Area = e.Area
	mySpaceList.append(mySpace)

OUT = mySpaceList
# ----------------------------------------
python_script_2 = Python(IN[0]=python_script)
# ---------- python_script_2.python (1 lines) ----------
OUT = dir(IN[0][0]), [[e.Id, e.Name, e.Area] for e in IN[0]]
# ----------------------------------------
