# Dynamo graph pythonInDynamo.dyn (Dynamo 1.3.2.2480)

code_block = CodeBlock { 1..10; }
python_script = Python(IN[0]=code_block)
# ---------- python_script.python (15 lines) ----------
import clr
clr.AddReference('ProtoGeometry')
from Autodesk.DesignScript.Geometry import *

clr.AddReference('DSCoreNodes')
from DSCore import *


#The inputs to this node will be stored as a list in the IN variables.
dataEnteringNode = IN

inputList = IN[0]

#Assign your output to the OUT variable.
OUT = List.RestOfItems(inputList)
# ----------------------------------------
python_script_2 = Python(IN[0]=code_block)
# ---------- python_script_2.python (16 lines) ----------
import clr
clr.AddReference('ProtoGeometry')
from Autodesk.DesignScript.Geometry import *

clr.AddReference('DSCoreNodes')
from DSCore import *


#The inputs to this node will be stored as a list in the IN variables.
dataEnteringNode = IN

inputList = IN[0]

newList = del inputList[0]
#Assign your output to the OUT variable.
OUT = newList
# ----------------------------------------
step = Core.Counter.Step()  # unwired: arg0, arg1
