# Dynamo graph pythonUI.dyn (Dynamo 2.1.0.5696)

refresh = BoolSelector(false)
python_script = Python(IN[0]=refresh)
# ---------- python_script.python (223 lines) ----------
import clr

clr.AddReference("System.Windows.Forms")
from System.Windows.Forms import Application, Button, Form, Label, TextBox, CheckBox, FolderBrowserDialog, OpenFileDialog, DialogResult, ComboBox, FormBorderStyle, FormStartPosition

clr.AddReference("System.Drawing")
from System.Drawing import *

clr.AddReference("System")
from System import EventHandler



familyName = [1,2,300]

distances = ""
formVoidWidth = 0
formVoidHeight = 0

form = Form()


def Form1Load(sender, e):
		for s in familyName:
			comboBoxCategory.Items.Add(s);
					
def Ok_btnClick(sender, e):
	global distances
	distances = textBox1.Text;
	global formVoidWidth
	formVoidWidth = int(textBoxWidth.Text);
	global formVoidHeight
	formVoidHeight = int(textBoxHeight.Text);
	if checkBoxStart.Checked:
		formPosition = "start";
	if checkBoxEnd.Checked:
		formPosition = "end";
	if checkBoxMidPoint.Checked:
		formPosition = "mid"; 

def ComboBoxCategorySelectedIndexChanged(sender, e):
	comboBoxCategory.SelectedItem.ToString()

def CheckBoxStart_Click(sender, e):
	checkBoxEnd.Checked = False;
	checkBoxMidPoint.Checked = False;

def CheckBoxEnd_Click(sender, e):
	checkBoxStart.Checked = False;
	checkBoxMidPoint.Checked = False;


ok_btn = Button();
textBox1 = TextBox();
label1 = Label();
comboBoxCategory = ComboBox();
label2 = Label();
btn_cancel = Button();
textBoxWidth = TextBox();
textBoxHeight = TextBox();
label3 = Label();
label4 = Label();
checkBoxStart = CheckBox();
checkBoxEnd = CheckBox();
checkBoxMidPoint = CheckBox();
#SuspendLayout();

# 
# ok_btn
ok_btn.DialogResult = DialogResult.OK;
ok_btn.Location = Point(38, 207);
ok_btn.Name = "ok_btn";
ok_btn.Size = Size(90, 29);
ok_btn.TabIndex = 0;
ok_btn.Text = "OK";
ok_btn.UseCompatibleTextRendering = True;
ok_btn.UseVisualStyleBackColor = True;
ok_btn.Click += EventHandler(Ok_btnClick);

# 
# textBox1
# 
textBox1.Location = Point(12, 161);
textBox1.Name = "textBox1";
textBox1.Size = Size(261, 20);
textBox1.TabIndex = 1;
# 
# label1
# 
label1.Location = Point(12, 141);
label1.Name = "label1";
label1.Size = Size(249, 15);
label1.TabIndex = 2;
label1.Text = "Offset";
label1.UseCompatibleTextRendering = True;
# 
# comboBoxCategory
# 
comboBoxCategory.FormattingEnabled = True;
comboBoxCategory.Location = Point(13, 29);
comboBoxCategory.Name = "comboBoxCategory";
comboBoxCategory.Size = Size(261, 21);
comboBoxCategory.Sorted = True;
comboBoxCategory.TabIndex = 3;
comboBoxCategory.SelectedIndexChanged += EventHandler(ComboBoxCategorySelectedIndexChanged);
# 
# label2
# 
label2.Location = Point(13, 11);
label2.Name = "label2";
label2.Size = Size(155, 15);
label2.TabIndex = 5;
label2.Text = "Select Opening Family";
label2.UseCompatibleTextRendering = True;
# 
# btn_cancel
# 
btn_cancel.DialogResult = DialogResult.Cancel;
btn_cancel.Location = Point(157, 207);
btn_cancel.Name = "btn_cancel";
btn_cancel.Size = Size(86, 29);
btn_cancel.TabIndex = 6;
btn_cancel.Text = "Cancel";
btn_cancel.UseCompatibleTextRendering = True;
btn_cancel.UseVisualStyleBackColor = True;
# 
# textBoxWidth
# 
textBoxWidth.Location = Point(12, 74);
textBoxWidth.Name = "textBoxWidth";
textBoxWidth.Size = Size(100, 20);
textBoxWidth.TabIndex = 7;
# 
# textBoxHeight
# 
textBoxHeight.Location = Point(173, 74);
textBoxHeight.Name = "textBoxHeight";
textBoxHeight.Size = Size(100, 20);
textBoxHeight.TabIndex = 8;
# 
# label3
# 
label3.Location = Point(13, 56);
label3.Name = "label3";
label3.Size = Size(100, 15);
label3.TabIndex = 9;
label3.Text = "Width";
label3.UseCompatibleTextRendering = True;
# 
# label4
# 
label4.Location = Point(173, 56);
label4.Name = "label4";
label4.Size = Size(100, 15);
label4.TabIndex = 10;
label4.Text = "Height";
label4.UseCompatibleTextRendering = True;
# 
# checkBoxStart
# 
checkBoxStart.Location = Point(12, 105);
checkBoxStart.Name = "checkBoxStart";
checkBoxStart.Size = Size(104, 24);
checkBoxStart.TabIndex = 11;
checkBoxStart.Text = "Start Point";
checkBoxStart.UseCompatibleTextRendering = True;
checkBoxStart.UseVisualStyleBackColor = True;
checkBoxStart.Click += EventHandler(CheckBoxStart_Click);
# 
# checkBoxEnd
# 
checkBoxEnd.Location = Point(205, 105);
checkBoxEnd.Name = "checkBoxEnd";
checkBoxEnd.Size = Size(104, 24);
checkBoxEnd.TabIndex = 12;
checkBoxEnd.Text = "End Point";
checkBoxEnd.UseCompatibleTextRendering = True;
checkBoxEnd.UseVisualStyleBackColor = True;
checkBoxEnd.Click += EventHandler(CheckBoxEnd_Click);

# 
# checkBoxMidPoint
# 
checkBoxMidPoint.Checked = True;
checkBoxMidPoint.Location = Point(105, 105);
checkBoxMidPoint.Name = "checkBoxMidPoint";
checkBoxMidPoint.Size = Size(73, 24);
checkBoxMidPoint.TabIndex = 13;
checkBoxMidPoint.Text = "Mid Point";
checkBoxMidPoint.UseCompatibleTextRendering = True;
checkBoxMidPoint.UseVisualStyleBackColor = True;

# 
# Form1
# 

form.ClientSize = Size(289, 248);
form.Controls.Add(checkBoxMidPoint);
form.Controls.Add(checkBoxEnd);
form.Controls.Add(checkBoxStart);
form.Controls.Add(label4);
form.Controls.Add(label3);
form.Controls.Add(textBoxHeight);
form.Controls.Add(textBoxWidth);
form.Controls.Add(btn_cancel);
form.Controls.Add(label2);
form.Controls.Add(comboBoxCategory);
form.Controls.Add(label1);
form.Controls.Add(textBox1);
form.Controls.Add(ok_btn);
form.Name = "Form1";
form.Text = "Place Instance By Face";
form.Load += EventHandler(Form1Load);
form.StartPosition = FormStartPosition.CenterScreen

form.ShowDialog()


cboxMid = checkBoxMidPoint.Checked

OUT = comboBoxCategory.SelectedItem.ToString(), formVoidWidth, formVoidHeight, cboxMid, distances

#replace .this with the form variable name
# ----------------------------------------
