# Dynamo graph readFromExcel.dyn (Dynamo 1.3.1.1736)

file_path = Filename("C:\Users\giovanni.brogiolo\Desktop\coords.xlsx")
fromPath = FileObject(file_path)  # "File.FromPath"
code_block = CodeBlock { "Sheet1"; }
readFromFile = Excel.ReadFromFile(file=fromPath, sheetName=code_block)

# group: remove titles
restOfItems = List.RestOfItems(readFromFile)

# group: divide cable names and points
deconstruct = List.Deconstruct(list=restOfItems, lacing=Longest)

code_block_2 = CodeBlock { 3; }

# group: group points by XYZ
chop = List.Chop(list=deconstruct.rest, lengths=code_block_2, lacing=Longest)

python_script = Python(IN[0]=chop)
# ---------- python_script.python (18 lines) ----------
import clr
clr.AddReference('ProtoGeometry')
from Autodesk.DesignScript.Geometry import *
#The inputs to this node will be stored as a list in the IN variables.

pts = IN[0]

points = []

for i in range(0,len(pts)):
	pt = []
	points.append(pt)
	for j in range(0,len(pts[i])):
		pt.append(Point.ByCoordinates(pts[i][j][0],pts[i][j][1],pts[i][j][2]))


#Assign your output to the OUT variable.
OUT = points
# ----------------------------------------

# group: Add the point name to each list
addItemToFront = List.AddItemToFront(item=deconstruct.first, list=python_script, lacing=Longest)
