# Dynamo graph regex2.dyn (Dynamo 2.0.0.3911)

string = StringInput("1.5kPa DL + 2kPa SDL + 3kPa LL")
code_block = CodeBlock(a=string) { {{a},{a},{a}}; }
python_script = Python(IN[0]=code_block)
# ---------- python_script.python (10 lines) ----------
import re

resultingNum = []
for number in IN[0]:
	Lists = []
	for values in number:
		Lists.append(re.findall(r'^[+-]?\d*\.?\d*', values))
	resultingNum.append(Lists)

OUT = resultingNum
# ----------------------------------------
python_script_2 = Python(IN[0]=code_block)
# ---------- python_script_2.python (10 lines) ----------
import re

resultingNum = []
for number in IN[0]:
	Lists = []
	for values in number:
		Lists.append(re.findall(r'([\d.]+)', values))
	resultingNum.append(Lists)

OUT = resultingNum
# ----------------------------------------
