# Dynamo graph renumberGrids.dyn (Dynamo 2.1.0.6255)

select_model_elements = DSModelElementsSelection()  # 19 picked in the model
code_block = CodeBlock(a=select_model_elements) { DSCore.List.Flatten([a[0],a[18],a[1..17]]); }
reverse = List.Reverse(list=code_block)
name = Element.Name(element=reverse)
code_block_2 = CodeBlock { "Name"; }
code_block_3 = CodeBlock { 21..3; }
string_from_object = FromObject(obj=code_block_3)
setParameterByName = Element.SetParameterByName(element=reverse, parameterName=code_block_2, value=string_from_object)
