# Dynamo graph reportParameter.dyn (Dynamo 1.3.2.2480)

categories = Categories("StructuralFraming")
all_elements_of_category = ElementsOfCategory(categories)

# group: Equivalent to below
code_block = CodeBlock { "Type"; }
getParameterValueByName = Element.GetParameterValueByName(element=all_elements_of_category, parameterName=code_block)
name = Element.Name(getParameterValueByName)
uniqueItems = List.UniqueItems(name)
allIndicesOf = List.AllIndicesOf(list=name, item=uniqueItems)
getItemAtIndex = List.GetItemAtIndex(list=all_elements_of_category, index=allIndicesOf)
code_block_2 = CodeBlock { "Volume"; }
getParameterValueByName_2 = Element.GetParameterValueByName(element=getItemAtIndex, parameterName=code_block_2)

name_2 = Element.Name()  # unwired: arg0
groupByFunction = GroupByFunction(all_elements_of_category, name_2)
code_block_3 = CodeBlock { "Volume"; }
getParameterValueByName_3 = Element.GetParameterValueByName(element=groupByFunction, parameterName=code_block_3)
python_script = Python(IN[0]=getParameterValueByName_3)
# ---------- python_script.python (12 lines) ----------
add = IN[0]

sum = []

for a in add:
	subSum = [0]
	sum.append(subSum)
	for i in range(0,len(a)):
		subSum.append(subSum[i]+a[i])

#Assign your output to the OUT variable.
OUT = [s[-1] for s in sum]
# ----------------------------------------
