# Dynamo graph revUP.dyn (Dynamo 2.0.1.4955)

categories = Categories(index=422)
all_elements_of_category = ElementsOfCategory(Category=categories)
sheetNumber = Sheet.SheetNumber(sheet=all_elements_of_category)
code_block = CodeBlock()
# ---------- code_block.designscript (24 lines) ----------
["S-11-100",
"S-11-101",
"S-11-110",
"S-11-111",
"S-11-120",
"S-11-121",
"S-11-130",
"S-11-131",
"S-11-140",
"S-11-141",
"S-11-150",
"S-11-151",
"S-11-160",
"S-11-161",
"S-11-170",
"S-11-171",
"S-11-180",
"S-11-181",
"S-11-190",
"S-11-191",
"S-11-200",
"S-11-201",
"S-11-210",
"S-11-220","S-11-081"];
# ----------------------------------------
allIndicesOf = List.AllIndicesOf(list=sheetNumber, item=code_block)
getItemAtIndex = List.GetItemAtIndex(list=all_elements_of_category, index=allIndicesOf)
flatten = List.Flatten(list=getItemAtIndex)
code_block_2 = CodeBlock { "Next Issue List"; }
code_block_3 = CodeBlock { 1; }
setParameterByName = Element.SetParameterByName(element=flatten, parameterName=code_block_2, value=code_block_3)
code_block_4 = CodeBlock { "Arup DIP Stamp"; }
code_block_5 = CodeBlock { 1; }
byViewsName = Custom[Springs.ViewSet.ByViewsName](views=flatten, setName=code_block_2, Overwrite=code_block_5)  # Creates a set of views(or sheets) for printing. If the set exists, set Overwrite to true to replace it.
titleblock = Rhythm.Revit.Elements.Sheet.Titleblock()  # unwired: viewSheet
code_block_6 = CodeBlock { "CertificationStamp"; }
