# Dynamo graph scriptNameGenerator.dyn (Dynamo 1.3.1.1736)

# group: Folder Path
string = StringInput("\\cadtools\cadtools\Miscellaneous\Dynamo\Scripts\Dynamo Script Library\0.1.0 Shared\Giovanni Brogiolo")

code_block = CodeBlock(a=string) { a; }
fromPath = DirectoryObject(code_block)  # "Directory.FromPath"
contents = Directory.Contents(fromPath)
string_2 = StringInput("\")

# group: File path splitted
split = String.Split(contents, string_2)

# group: FileName Index
code_block_2 = CodeBlock { 8; }

getItemAtIndex = List.GetItemAtIndex(list=split, index=code_block_2, lacing=Longest)
code_block_3 = CodeBlock { "dyn"; }
contains = String.Contains(str=getItemAtIndex, searchFor=code_block_3)
filterByBoolMask = List.FilterByBoolMask(list=getItemAtIndex, mask=contains)
code_block_4 = CodeBlock { "."; }
split_2 = String.Split(filterByBoolMask.in, code_block_4)
deconstruct = List.Deconstruct(list=split_2, lacing=Longest)

# group: SET FILE NAME
string_3 = StringInput("""ARC Architecture 
BPH Building Physics 
CIV Civil Engineering 
CTR Controls / BMS 
ELE Electrical Engineering 
FAC Facades / Architectural Engineering 
FRE Fire Engineering 
FRS Fire Services 
LIT Lighting 
MEC Mechanical Engineering 
PHE Public Health Engineering / Hydraulics 
STR Structures 
SUS Sustainability / ESD 
XXX All """)
string_4 = StringInput("""DAT Data Manipulation tools 
DES Design tools 
ADM Administrative tools 
CHK Checking tools 
SUB Sub-script or custom node """)
string_5 = StringInput("SERIES[0]+PRIME DIGITS[00]+RELATION[0]")
string_6 = StringInput("""1.X.X Version (0 = WIP) 
X.1.X Shared Status 
X.X.1 WIP Status """)
n1_software = CodeBlock { "DYN"; }  # "1. SOFTWARE"
n2_discipline = CodeBlock()  # "2. DISCIPLINE"
# ---------- n2_discipline.designscript (14 lines) ----------
{"ARC",
"BPH",
"CIV",
"CTR",
"ELE",
"FAC",
"FRE",
"FRS",
"LIT",
"MEC",
"PHE",
"STR",
"SUS",
"XXX"};
# ----------------------------------------
code_block_5 = CodeBlock(a=n2_discipline) { a[13]; }
n3_function = CodeBlock()  # "3. FUNCTION"
# ---------- n3_function.designscript (5 lines) ----------
{"DAT",
"DES",
"ADM",
"CHK",
"SUB"};
# ----------------------------------------
code_block_6 = CodeBlock(a=n3_function) { a[0]; }
n4_number = CodeBlock { "001"; }  # "4. NUMBER"
n5_name = CodeBlock(Name=deconstruct.first) { Name; }  # "5. NAME"
n6_suitability = CodeBlock { "_0.1.0"; }  # "6. SUITABILITY"
code_block_7 = CodeBlock(a=n1_software, b=code_block_5, c=code_block_6, d=n4_number, e=n5_name, f=n6_suitability) { a+"-"+b+"-"+c+"-"+d+"-"+e+f; }

code_block_8 = CodeBlock(a=code_block_7, g=deconstruct.rest) { a+"."+Flatten(g); }

# group: Rename Files
# note: NewNames
# note: Folder Path
python_script = Python(IN[0]=code_block, IN[1]=code_block_8)
# ---------- python_script.python (28 lines) ----------
# Copyright(c) 2016, Konrad Sobon
# @arch_laboratory, http://archi-lab.net

import sys
pyt_path = r'C:\Program Files (x86)\IronPython 2.7\Lib'
sys.path.append(pyt_path)

import os

filePath = IN[0]
newName = IN[1]

files = os.listdir(filePath)

currentFileName = []
newFileName = []

for file in files:
	if "dyn" in file:
		currentFileName.append(filePath + "\\" + file)


for i in range(0,len(currentFileName)):
	newFileName = filePath + "\\" + newName[i]
	os.rename(currentFileName[i], newFileName)


OUT = newFileName
# ----------------------------------------

code_block_9 = CodeBlock(a=code_block, b=code_block_7) { a+"\\"+b+".readme.txt"; }
n1_script_name = CodeBlock(a=n5_name) { "Script Name: "+a; }  # "1. Script Name"
string_7 = StringInput("""
Purpose: 
Keywords: 
Discipline: GEN
Function: DOC
Suitability: 0.1.0
Region: GLO
Author: Giovanni Brogiolo
Dynamo Version: 1.3.1
Packages: N/A
Date Modified: """)
python_script_2 = Python(IN[0]=n1_script_name, IN[1]=string_7)
# ---------- python_script_2.python (15 lines) ----------
import clr
clr.AddReference('ProtoGeometry')
from Autodesk.DesignScript.Geometry import *
#The inputs to this node will be stored as a list in the IN variables.
name = IN[0]

renamed = IN[1]

final = []

for n in name:
	final.append(n+renamed)

#Assign your output to the OUT variable.
OUT = final
# ----------------------------------------

# group: Create txt files
writeText = File.WriteText(code_block_9, python_script_2)
