# Dynamo graph setActiveWorkset.dyn (Dynamo 2.0.1.5055)

worksets = WorksetUi(index=9)
python_script = Python(IN[0]=worksets)
# ---------- python_script.python (28 lines) ----------
# Enable Python support and load DesignScript library
import clr

clr.AddReference("RevitAPI")
import Autodesk
from Autodesk.Revit.DB import *

clr.AddReference("RevitServices")
import RevitServices
from RevitServices.Persistence import DocumentManager

from System.Collections.Generic import List

doc = DocumentManager.Instance.CurrentDBDocument

wt = doc.GetWorksetTable()

fec = FilteredWorksetCollector(doc)

#find all user worksets
fec.OfKind(WorksetKind.UserWorkset);

worksets = fec.ToWorksets();

for w in worksets:
	if w.Name == IN[0].Name:
		WorksetTable.SetActiveWorksetId(wt, w.Id)
		OUT = w.Name
# ----------------------------------------
id = Element.Id()  # unwired: element
