# Dynamo graph setParam.dyn (Dynamo 1.3.1.1736)

select_model_elements = DSModelElementsSelection()  # 3 picked in the model
code_block = CodeBlock { {"Width","Height"}; }
code_block_2 = CodeBlock { {1000,2000}; }
code_block_3 = CodeBlock { {1500,2500}; }
code_block_4 = CodeBlock { {2500,3000}; }
code_block_5 = CodeBlock(a=code_block_2, b=code_block_3, c=code_block_4) { {a,b,c}; }
setParameterByName = Element.SetParameterByName(element=select_model_elements, parameterName=code_block, value=code_block_5)
