# Dynamo graph setViewportsPosition.dyn (Dynamo 1.3.3.4651)

select_model_elements = DSModelElementsSelection()  # 13 picked in the model

# group: Set schedules position
select_model_elements_2 = DSModelElementsSelection()  # 2 picked in the model
select_model_elements_3 = DSModelElementsSelection()  # 2 picked in the model
python_script = Python(IN[0]=select_model_elements_3)
# ---------- python_script.python (31 lines) ----------
# Copyright(c) 2017, Konrad K Sobon
# @arch_laboratory, http://archi-lab.net

import clr
import sys

pyt_path = r'C:\Program Files (x86)\IronPython 2.7\Lib'
sys.path.append(pyt_path)

clr.AddReference('ProtoGeometry')
from Autodesk.DesignScript.Geometry import *

clr.AddReference("RevitNodes")
import Revit

clr.ImportExtensions(Revit.Elements)
clr.ImportExtensions(Revit.GeometryConversion)

clr.AddReference("RevitServices")
from RevitServices.Persistence import DocumentManager
from RevitServices.Transactions import TransactionManager

doc = DocumentManager.Instance.CurrentDBDocument

clr.AddReference("RevitAPI")
import Autodesk
from Autodesk.Revit.DB import *

schedules = UnwrapElement(IN[0])

OUT = [s.Point for s in schedules]
# ----------------------------------------
python_script_2 = Python(IN[0]=select_model_elements_2, IN[1]=python_script)
# ---------- python_script_2.python (42 lines) ----------
# Copyright(c) 2017, Konrad K Sobon
# @arch_laboratory, http://archi-lab.net

import clr
import sys

pyt_path = r'C:\Program Files (x86)\IronPython 2.7\Lib'
sys.path.append(pyt_path)

clr.AddReference('ProtoGeometry')
from Autodesk.DesignScript.Geometry import *

clr.AddReference("RevitNodes")
import Revit

clr.ImportExtensions(Revit.Elements)
clr.ImportExtensions(Revit.GeometryConversion)

clr.AddReference("RevitServices")
from RevitServices.Persistence import DocumentManager
from RevitServices.Transactions import TransactionManager

doc = DocumentManager.Instance.CurrentDBDocument

clr.AddReference("RevitAPI")
import Autodesk
from Autodesk.Revit.DB import *

schedules = UnwrapElement(IN[0])
points = UnwrapElement(IN[1])

output = []

TransactionManager.Instance.EnsureInTransaction(doc)

for s,p in zip(schedules,points):
	s.Point = p
	output.append(s)

TransactionManager.Instance.TransactionTaskDone()

OUT = output
# ----------------------------------------

# group: Set viewport position
select_model_elements_4 = DSModelElementsSelection()  # 2 picked in the model
select_model_elements_5 = DSModelElementsSelection()  # 2 picked in the model
python_script_3 = Python(IN[0]=select_model_elements_5)
# ---------- python_script_3.python (31 lines) ----------
# Copyright(c) 2017, Konrad K Sobon
# @arch_laboratory, http://archi-lab.net

import clr
import sys

pyt_path = r'C:\Program Files (x86)\IronPython 2.7\Lib'
sys.path.append(pyt_path)

clr.AddReference('ProtoGeometry')
from Autodesk.DesignScript.Geometry import *

clr.AddReference("RevitNodes")
import Revit

clr.ImportExtensions(Revit.Elements)
clr.ImportExtensions(Revit.GeometryConversion)

clr.AddReference("RevitServices")
from RevitServices.Persistence import DocumentManager
from RevitServices.Transactions import TransactionManager

doc = DocumentManager.Instance.CurrentDBDocument

clr.AddReference("RevitAPI")
import Autodesk
from Autodesk.Revit.DB import *

schedules = UnwrapElement(IN[0])

OUT = [s.GetBoxCenter() for s in schedules]
# ----------------------------------------
python_script_4 = Python(IN[0]=select_model_elements_4, IN[1]=python_script_3)
# ---------- python_script_4.python (42 lines) ----------
# Copyright(c) 2017, Konrad K Sobon
# @arch_laboratory, http://archi-lab.net

import clr
import sys

pyt_path = r'C:\Program Files (x86)\IronPython 2.7\Lib'
sys.path.append(pyt_path)

clr.AddReference('ProtoGeometry')
from Autodesk.DesignScript.Geometry import *

clr.AddReference("RevitNodes")
import Revit

clr.ImportExtensions(Revit.Elements)
clr.ImportExtensions(Revit.GeometryConversion)

clr.AddReference("RevitServices")
from RevitServices.Persistence import DocumentManager
from RevitServices.Transactions import TransactionManager

doc = DocumentManager.Instance.CurrentDBDocument

clr.AddReference("RevitAPI")
import Autodesk
from Autodesk.Revit.DB import *

schedules = UnwrapElement(IN[0])
points = UnwrapElement(IN[1])

output = []

TransactionManager.Instance.EnsureInTransaction(doc)

for s,p in zip(schedules,points):
	s.SetBoxCenter(p)
	output.append(s)

TransactionManager.Instance.TransactionTaskDone()

OUT = output
# ----------------------------------------

placeViewsOnSheets = Custom[Tool.PlaceViewsOnSheets]()  # Places existing views on existing sheets; unwired: Sheet_List, Views_List, Points_List
sheets = Sheets("25-1-G01B : Bottom Beam Ligs - Building 1 (Superfloor) - Ground Floor - Zone 1")
select_model_elements_6 = DSModelElementsSelection()  # 1 picked in the model
python_script_5 = Python(IN[0]=select_model_elements_6)
# ---------- python_script_5.python (31 lines) ----------
# Copyright(c) 2017, Konrad K Sobon
# @arch_laboratory, http://archi-lab.net

import clr
import sys

pyt_path = r'C:\Program Files (x86)\IronPython 2.7\Lib'
sys.path.append(pyt_path)

clr.AddReference('ProtoGeometry')
from Autodesk.DesignScript.Geometry import *

clr.AddReference("RevitNodes")
import Revit

clr.ImportExtensions(Revit.Elements)
clr.ImportExtensions(Revit.GeometryConversion)

clr.AddReference("RevitServices")
from RevitServices.Persistence import DocumentManager
from RevitServices.Transactions import TransactionManager

doc = DocumentManager.Instance.CurrentDBDocument

clr.AddReference("RevitAPI")
import Autodesk
from Autodesk.Revit.DB import *

schedules = UnwrapElement(IN[0])

OUT = [doc.GetElement(schedules.ViewId)]
# ----------------------------------------
python_script_6 = Python(IN[0]=select_model_elements_6)
# ---------- python_script_6.python (31 lines) ----------
# Copyright(c) 2017, Konrad K Sobon
# @arch_laboratory, http://archi-lab.net

import clr
import sys

pyt_path = r'C:\Program Files (x86)\IronPython 2.7\Lib'
sys.path.append(pyt_path)

clr.AddReference('ProtoGeometry')
from Autodesk.DesignScript.Geometry import *

clr.AddReference("RevitNodes")
import Revit

clr.ImportExtensions(Revit.Elements)
clr.ImportExtensions(Revit.GeometryConversion)

clr.AddReference("RevitServices")
from RevitServices.Persistence import DocumentManager
from RevitServices.Transactions import TransactionManager

doc = DocumentManager.Instance.CurrentDBDocument

clr.AddReference("RevitAPI")
import Autodesk
from Autodesk.Revit.DB import *

schedules = UnwrapElement(IN[0])

OUT = [schedules.GetBoxCenter()]
# ----------------------------------------
python_script_7 = Python(IN[0]=sheets, IN[1]=python_script_5, IN[2]=python_script_6)
# ---------- python_script_7.python (49 lines) ----------
#python nodes in dynamo 1.2
#proposed by Julien Benoit @jbenoit44 
#http://aecuandme.wordpress.com/
import clr
clr.AddReference('ProtoGeometry')
from Autodesk.DesignScript.Geometry import *
# Import ToDSType(bool) extension method
clr.AddReference("RevitNodes")
import Revit
clr.ImportExtensions(Revit.Elements)
# Import geometry conversion extension methods
clr.ImportExtensions(Revit.GeometryConversion)
# Import DocumentManager and TransactionManager
clr.AddReference("RevitServices")
import RevitServices
from RevitServices.Persistence import DocumentManager
from RevitServices.Transactions import TransactionManager
from System.Collections.Generic import *
# Import RevitAPI
clr.AddReference("RevitAPI")
import Autodesk
from Autodesk.Revit.DB import *

doc = DocumentManager.Instance.CurrentDBDocument
uiapp = DocumentManager.Instance.CurrentUIApplication
app = uiapp.Application
uidoc=DocumentManager.Instance.CurrentUIApplication.ActiveUIDocument

sheets = []
for i in [IN[0]]:
	sheets.append(UnwrapElement(i))
views=[]	
for i in IN[1]:
	views.append(UnwrapElement(i))
points=[]	
for i in IN[2]:
	points.append(UnwrapElement(i))

# Start Transaction
TransactionManager.Instance.EnsureInTransaction(doc)
viewp=[]
for s,v,p in zip(sheets,views,points):
	a=Viewport.Create(doc, s.Id,v.Id, p)
	viewp.append(a)

# End Transaction
TransactionManager.Instance.TransactionTaskDone()

OUT=viewp
# ----------------------------------------
