# Dynamo graph shortestPathSimplified.dyn (Dynamo 2.1.0.6255)

code_block = CodeBlock {  }
python_script = Python()  # unwired: IN[0]
# ---------- python_script.python (25 lines) ----------
def find_shortest_path(graph, start, end, path=[]):
    path = path + [start]
    if start == end:
        return path
    if not graph.has_key(start): 
        return 'start node is not a key of the graph'
    shortest = None
    for node in graph[start]:
        if node not in path:
            newpath = find_shortest_path(graph, node, end, path)
            if newpath:
                if not shortest or len(newpath) < len(shortest):
                    shortest = newpath
    return shortest

graph = {'A': ['B', 'C'],
         'B': ['C', 'A'],
         'C': ['D','A','B'],
         'E': ['F','D','G'],
         'F': ['E'],
         'G': ['D','E','H'],
         'D': ['C','G','E'],
         'H': ['G']}
         
OUT = find_shortest_path(graph, 'C', 'H')
# ----------------------------------------
python_script_2 = Python()  # unwired: IN[0]
# ---------- python_script_2.python (20 lines) ----------
graph = {'A': ['B', 'C'],
         'B': ['C', 'A'],
         'C': ['D','A','B'],
         'D': ['C','G','E'],
         'E': ['F','D','G'],
         'F': ['E'],
         'G': ['D','E','H'],
         'H': ['G']}

r = ''
if not graph.has_key('I'):
	r = 'aaa'

path = []
start = 'C'
path = path + [start]



OUT = path
# ----------------------------------------
