# Dynamo graph swapColumnsBeams.dyn (Dynamo 0.8.2.2392)

# group: select beam
select_model_element = DSModelElementSelection()

# group: SELECT DWG AND CREATE MODEL LINES
code_block = CodeBlock(a=select_model_element) { {a}; }
select_model_element_2 = DSModelElementSelection()
curves = Element.Curves(select_model_element_2)
code_block_2 = CodeBlock { {0,1}; }
pointAtParameter = Curve.PointAtParameter(curve=curves, param=code_block_2, lacing=Longest)
code_block_3 = CodeBlock(a=pointAtParameter) { {a}; }
python_script = Python(IN[0]=code_block, IN[1]=code_block_3)
# ---------- python_script.python (42 lines) ----------
import clr

clr.AddReference("RevitServices")
import RevitServices
from RevitServices.Persistence import DocumentManager
from RevitServices.Transactions import TransactionManager
doc = DocumentManager.Instance.CurrentDBDocument

clr.AddReference("RevitAPI")
import Autodesk
from Autodesk.Revit.DB import *

clr.AddReference("RevitNodes")
import Revit
clr.ImportExtensions(Revit.Elements)
clr.ImportExtensions(Revit.GeometryConversion)

clr.AddReference("System")
from System.Collections.Generic import List

beamElements = UnwrapElement(IN[0])
pts = UnwrapElement(IN[1])

beamLocations = []

for beam in beamElements:
	beamLocations.append(beam.Location)

newBeamLine = []

TransactionManager.Instance.EnsureInTransaction(doc)

for i in range(0,len(beamLocations)):
	newBeamLine = Line.CreateBound(pts[i][0].ToXyz(), pts[i][1].ToXyz())
	#Change the beam location line to a new line:
	beamLocations[i].Curve = newBeamLine;

            

TransactionManager.Instance.TransactionTaskDone()

OUT = beamElements
# ----------------------------------------
select_model_element_3 = DSModelElementSelection()
python_script_2 = Python(IN[0]=select_model_element_3)
# ---------- python_script_2.python (34 lines) ----------
#Copyright 2017. All rights reserved. Bimorph Consultancy LTD, 5 St Johns Lane, London EC1M 4BH www.bimorph.co.uk
#Written by Thomas Mahon @Thomas__Mahon info@bimorph.co.uk Package: bimorphNodes
#GitHub: https://github.com/ThomasMahon/bimorphNodes/
#Follow: facebook.com/bimorphBIM | linkedin.com/company/bimorph-bim | @bimorphBIM

import clr

# Import RevitAPI
clr.AddReference("RevitAPI")
import Autodesk
from Autodesk.Revit.DB import *

dwgImport = IN[0]

if isinstance(dwgImport, list):
	singleton = False
else:
	singleton = True
	dwgImport = [dwgImport]

layerList = []
for dwg in dwgImport:
	dwgAPI = UnwrapElement(dwg)
	catSub = dwgAPI.Category.SubCategories
	enum = catSub.GetEnumerator()
	
	subList = []
	while enum.MoveNext():
		layerName = enum.Current.Name
		subList.Add( layerName )
		
	layerList.append(subList)
		
OUT = layerList[0] if singleton else layerList  #Preserve behaviour of node prior to v2.1
# ----------------------------------------
code_block_4 = CodeBlock(a=python_script_2) { a[0]; }
boolean = BoolSelector(false)
levels = Levels()
python_script_3 = Python(IN[0]=select_model_element_3, IN[1]=code_block_4, IN[2]=boolean, IN[3]=levels)
# ---------- python_script_3.python (136 lines) ----------
#Copyright 2016. All rights reserved. Bimorph Consultancy LTD, 5 St Johns Lane, London EC1M 4BH www.bimorph.co.uk
#Written by Thomas Mahon @Thomas__Mahon info@bimorph.co.uk package: bimorphNodes
#GitHub: https://github.com/ThomasMahon/bimorphNodes/

import clr

# Import DocumentManager and TransactionManager
clr.AddReference("RevitServices")
import RevitServices
from RevitServices.Persistence import DocumentManager
from RevitServices.Transactions import TransactionManager
from System.Collections.Generic import *

clr.AddReference("RevitNodes")
import Revit
# Import ToProtoType, ToRevitType geometry conversion extension methods
clr.ImportExtensions(Revit.GeometryConversion)

# Import RevitAPI
clr.AddReference("RevitAPI")
import Autodesk
from Autodesk.Revit.DB import *

doc = DocumentManager.Instance.CurrentDBDocument
uiapp = DocumentManager.Instance.CurrentUIApplication
app = uiapp.Application

importDWG = UnwrapElement(IN[0])
nameOfLayersToImport = IN[1]
revitModelLines = IN[2]

if nameOfLayersToImport == None or nameOfLayersToImport == []: 
	catSub = importDWG.Category.SubCategories
	enum = catSub.GetEnumerator()
	
	nameOfLayersToImport = []
	while enum.MoveNext():
		layerName = enum.Current.Name
		nameOfLayersToImport.Add( layerName )

if isinstance(nameOfLayersToImport, list):
	layerList = nameOfLayersToImport
else:
	layerList = [nameOfLayersToImport]

def storageDictionary(crvListDict, eleGraphicStyleName, e):
	if eleGraphicStyleName in crvListDict.keys(): 
		crvListDict[eleGraphicStyleName].append( e )
	else:
		crvListDict[eleGraphicStyleName] = []
		crvListDict[eleGraphicStyleName].append( e )
		
	
def curveConversion (crv, revitModelLines, crvObject, refPlane):
	if revitModelLines == True:
		crv.Add( doc.Create.NewModelCurve( crvObject, refPlane) )
	else:
		crv.Add( crvObject.ToProtoType() )
	
TransactionManager.Instance.EnsureInTransaction(doc)

geomEnum = importDWG.Geometry[ Options() ].GetEnumerator()

crvListDict = dict()
failedFilter = []
while geomEnum.MoveNext(): 
	instGeom = geomEnum.Current.GetInstanceGeometry()
	
	instGeomEnum = instGeom.GetEnumerator()
	while instGeomEnum.MoveNext():
		e = instGeomEnum.Current
		try:
			graphicStyleId = e.GraphicsStyleId
					
			eleGraphicStyle = doc.GetElement(graphicStyleId)
			eleGraphicStyleName = eleGraphicStyle.GraphicsStyleCategory.Name
			
			
			if eleGraphicStyleName in layerList: 
				storageDictionary(crvListDict, eleGraphicStyleName, e)

		except:
			try: 
				vol = e.Volume
				
				if vol == 0.0: 
					edgesList = e.Edges
					edgesEnum = edgesList.GetEnumerator()

					while edgesEnum.MoveNext():
						edge = edgesEnum.Current
						eleGraphicStyle = doc.GetElement(edge.GraphicsStyleId)
						eleGraphicStyleName = eleGraphicStyle.GraphicsStyleCategory.Name
						
						if eleGraphicStyleName in layerList:
							storageDictionary(crvListDict, eleGraphicStyleName, edge.AsCurve() )
							
			except: 
				failedFilter.Add(e)

if "2015" in app.VersionName:
	levelParam = "Base Level"
else:
	levelParam = BuiltInParameter.IMPORT_BASE_LEVEL

levelId = UnwrapElement(IN[3]).Id

pln = SketchPlane.Create(doc, levelId )
	
crvList = [ crv for crv in crvListDict.values() ] 

failedConversion = []
modelLines =  []
for subList in crvList: 
	crv = []
	for i in subList: 
		try:
			crvType = i.GetType()
			if crvType != Autodesk.Revit.DB.PolyLine:
				curveConversion(crv, revitModelLines, i, pln)
			else: 
				pt = i.GetCoordinates()
				count = i.NumberOfCoordinates
					
				for j in range(count-1): 
					ln = Line.CreateBound(pt[j], pt[j+1])
					curveConversion(crv, revitModelLines, ln, pln)
						
		except: 
			failedConversion.Add( i )
				
	modelLines.Add(crv)

TransactionManager.Instance.TransactionTaskDone()

OUT = modelLines, crvListDict.keys()
# ----------------------------------------
code_block_5 = CodeBlock(a=python_script_3) { a[0][0]; }
byCurve = ModelCurve.ByCurve(code_block_5)

python_script_4 = Python()
# ---------- python_script_4.python (33 lines) ----------
#Copyright(c) 2017, john pierson
# @60secondrevit, http://sixtysecondrevit.com
#Based on a node from Dimitar Venkov
#adapted by john pierson for rhythm
import clr

clr.AddReference("RevitAPIUI")
from  Autodesk.Revit.UI import *

clr.AddReference("RevitServices")
import RevitServices
from RevitServices.Persistence import DocumentManager
doc = DocumentManager.Instance.CurrentDBDocument
uidoc=DocumentManager.Instance.CurrentUIApplication.ActiveUIDocument

clr.AddReference("RevitNodes")
import Revit
clr.ImportExtensions(Revit.Elements)

sel1 = uidoc.Selection
ot1 = Selection.ObjectType.Element
el_ref = sel1.PickObjects(ot1, "Select model elements")
typelist = list()
idlist = list()
for i in el_ref:
	
	try:
		typelist.append(doc.GetElement(i.ElementId))
	except:
		typelist.append(list())
		

OUT = typelist
# ----------------------------------------
python_script_5 = Python()  # same code as python_script_4
curves_2 = Element.Curves(python_script_5)
code_block_6 = CodeBlock { 1; }
flatten = List.Flatten(list=curves_2, amt=code_block_6)
code_block_7 = CodeBlock { {0,1}; }
pointAtParameter_2 = Curve.PointAtParameter(curve=flatten, param=code_block_7, lacing=CrossProduct)
python_script_6 = Python(IN[1]=pointAtParameter_2)  # same code as python_script
location = FamilyInstance.Location()
select_model_elements = DSModelElementsSelection()
select_model_elements_2 = DSModelElementsSelection()
location_2 = Custom[Element.Location](element=select_model_elements_2)  # Returns the location of an element as an XYZ (or if it's line-based the start and end point of the line), along with some booleans to help filtering the results. Use this for some element types (e.g. walls or lines) that do not work with the built-in Get Family Instance Location node.
code_block_8 = CodeBlock(a=location_2.points) { a; }
code_block_9 = CodeBlock { Vector.ZAxis(); }
code_block_10 = CodeBlock { {"Top Offset", "Base Offset"}; }
getParameterValueByName = Element.GetParameterValueByName(element=select_model_elements_2, parameterName=code_block_10, lacing=CrossProduct)
python_script_7 = Python(IN[0]=getParameterValueByName)
# ---------- python_script_7.python (12 lines) ----------
import clr
clr.AddReference('ProtoGeometry')
from Autodesk.DesignScript.Geometry import *
#The inputs to this node will be stored as a list in the IN variables.
values = IN[0]
height = []

for i in range(0,len(values)):
	height.append(values[i][0]-values[i][1])

#Assign your output to the OUT variable.
OUT = height
# ----------------------------------------
translate = Geometry.Translate(geometry=code_block_8, direction=code_block_9, distance=python_script_7)
byStartPointEndPoint = Line.ByStartPointEndPoint(startPoint=code_block_8, endPoint=translate)
code_block_11 = CodeBlock { {0,1}; }
pointAtParameter_3 = Curve.PointAtParameter(curve=byStartPointEndPoint, param=code_block_11, lacing=CrossProduct)
python_script_8 = Python(IN[0]=select_model_elements, IN[1]=pointAtParameter_3)  # same code as python_script
