# Dynamo graph tagLinkedRooms.dyn (Dynamo 2.0.1.5055)

python_script = Python()  # unwired: IN[0], IN[1], IN[2], IN[3], IN[4], IN[5]
# ---------- python_script.python (146 lines) ----------
#Copyright(c) 2015, Konrad K Sobon
# @arch_laboratory, http://archi-lab.net

import clr
clr.AddReference('ProtoGeometry')
from Autodesk.DesignScript.Geometry import *

# Import Element wrapper extension methods
clr.AddReference("RevitNodes")
import Revit
clr.ImportExtensions(Revit.Elements)

# Import geometry conversion extension methods
clr.ImportExtensions(Revit.GeometryConversion)

# Import DocumentManager and TransactionManager
clr.AddReference("RevitServices")
import RevitServices
from RevitServices.Persistence import DocumentManager
from RevitServices.Transactions import TransactionManager

doc = DocumentManager.Instance.CurrentDBDocument
uiapp = DocumentManager.Instance.CurrentUIApplication
app = uiapp.Application

# Import RevitAPI
clr.AddReference("RevitAPI")
import Autodesk
from Autodesk.Revit.DB import *

import sys
pyt_path = r'C:\Program Files (x86)\IronPython 2.7\Lib'
sys.path.append(pyt_path)

#The inputs to this node will be stored as a list in the IN variable.
dataEnteringNode = IN

locationPts = UnwrapElement(IN[0])
tagType = UnwrapElement(IN[1])
elements = UnwrapElement(IN[2])

if IN[4] != None:
	link = UnwrapElement(IN[4])
else:
	link = None
	
RunIt = IN[5]

if isinstance(IN[3], list):
	views = [UnwrapElement(i) for i in IN[3]]
else:
	views = UnwrapElement(IN[3])

def toRvtPoint(point):
	return point.ToXyz()

def toRvtId(_id):
	if isinstance(_id, int) or isinstance(_id, str):
		id = ElementId(int(_id))
		return id
	elif isinstance(_id, ElementId):
		return _id

def GetUVPoint(pt):
	if type(pt) == Autodesk.DesignScript.Geometry.Point:
		return Autodesk.Revit.DB.UV(pt.X, pt.Y)
	elif type(pt) == Autodesk.DesignScript.Geometry.UV:
		return Autodesk.Revit.DB.UV(pt.U, pt.V)

def CreateSpaceTag(space, uv, view):
	doc = DocumentManager.Instance.CurrentDBDocument
	return doc.Create.NewSpaceTag(space, uv, view)

tagTypeId = toRvtId(tagType.Id)

try:
	errorReport = None
	if RunIt:
		if tagType.Category.Name == "Room Tags":
			TransactionManager.Instance.EnsureInTransaction(doc)
			roomTags = []
			if isinstance(views, list):
				for i, j, k in zip(elements, views, locationPts):
					roomId = LinkElementId(i.Id)
					location = Autodesk.Revit.DB.UV(toRvtPoint(k).X, toRvtPoint(k).Y)
					roomTag = doc.Create.NewRoomTag(roomId, location, j.Id)
					roomTag.RoomTagType = tagType
					roomTags.append(roomTag)
			else:
				for i, j in zip(elements, locationPts):
					if link != None:
						roomId = LinkElementId(link.Id, i.Id)
					else:
						roomId = LinkElementId(i.Id)
					location = Autodesk.Revit.DB.UV(toRvtPoint(j).X, toRvtPoint(j).Y)
					roomTag = doc.Create.NewRoomTag(roomId, location, views.Id)
					roomTag.RoomTagType = tagType
					roomTags.append(roomTag)
			TransactionManager.Instance.TransactionTaskDone()
			result = roomTags
		elif tagType.Category.Name == "Space Tags":
			TransactionManager.Instance.EnsureInTransaction(doc)
			roomTags = []
			if isinstance(views, list):
				for i, j, k in zip(elements, views, locationPts):
					uv = GetUVPoint(k)
					spaceTag = CreateSpaceTag(i, uv, j)
					spaceTag.SpaceTagType = tagType
					roomTags.append(spaceTag)
			else:
				for i, j in zip(elements, locationPts):
					uv = GetUVPoint(j)
					spaceTag = CreateSpaceTag(i, uv, views)
					spaceTag.SpaceTagType = tagType
					roomTags.append(spaceTag)
			TransactionManager.Instance.TransactionTaskDone()
			result = roomTags
		else:
			TransactionManager.Instance.EnsureInTransaction(doc)
			tags = []
			if isinstance(views, list):
				for i,j,k in zip(elements, views, locationPts):
					location = toRvtPoint(k)
					tag = doc.Create.NewTag(j, i, False, TagMode.TM_ADDBY_CATEGORY, TagOrientation.Horizontal, location)
					tag.ChangeTypeId(tagTypeId)
					tags.append(tag)
			else:
				for i, j in zip(elements, locationPts):
					location = toRvtPoint(j)
					tag = doc.Create.NewTag(views, i, False, TagMode.TM_ADDBY_CATEGORY, TagOrientation.Horizontal, location)
					tag.ChangeTypeId(tagTypeId)
					tags.append(tag)
			TransactionManager.Instance.TransactionTaskDone()
			result = tags
	else:
		result = "RunIt is set to False."
except:
	# if error accurs anywhere in the process catch it
	import traceback
	errorReport = traceback.format_exc()

#Assign your output to the OUT variable
if errorReport == None:
	OUT = result
else:
	OUT = errorReport
# ----------------------------------------
create_annotation_tag = Custom[Create Annotation Tag]()  # This node will create an annotation tag at a given location, of given type and in a supplied view. If only single view is supplied then all tags will be created in that view.; unwired: TagLocations, TagType, Elements, Views
python_script_2 = Python()  # unwired: IN[0], IN[1], IN[2], IN[3], IN[4], IN[5]
# ---------- python_script_2.python (107 lines) ----------
#Copyright(c) 2015, Konrad K Sobon
# @arch_laboratory, http://archi-lab.net

import clr
clr.AddReference('ProtoGeometry')
from Autodesk.DesignScript.Geometry import *

# Import Element wrapper extension methods
clr.AddReference("RevitNodes")
import Revit
clr.ImportExtensions(Revit.Elements)

# Import geometry conversion extension methods
clr.ImportExtensions(Revit.GeometryConversion)

# Import DocumentManager and TransactionManager
clr.AddReference("RevitServices")
import RevitServices
from RevitServices.Persistence import DocumentManager
from RevitServices.Transactions import TransactionManager

doc = DocumentManager.Instance.CurrentDBDocument
uiapp = DocumentManager.Instance.CurrentUIApplication
app = uiapp.Application

# Import RevitAPI
clr.AddReference("RevitAPI")
import Autodesk
from Autodesk.Revit.DB import *

import sys
pyt_path = r'C:\Program Files (x86)\IronPython 2.7\Lib'
sys.path.append(pyt_path)

#The inputs to this node will be stored as a list in the IN variable.
dataEnteringNode = IN

locationPts = UnwrapElement(IN[0])
tagType = UnwrapElement(IN[1])
elements = UnwrapElement(IN[2])

if IN[4] != None:
	link = UnwrapElement(IN[4])
else:
	link = None
	
RunIt = IN[5]

if isinstance(IN[3], list):
	views = [UnwrapElement(i) for i in IN[3]]
else:
	views = [UnwrapElement(IN[3])]

def toRvtPoint(point):
	return point.ToXyz()

def toRvtId(_id):
	if isinstance(_id, int) or isinstance(_id, str):
		id = ElementId(int(_id))
		return id
	elif isinstance(_id, ElementId):
		return _id

def GetUVPoint(pt):
	if type(pt) == Autodesk.DesignScript.Geometry.Point:
		return Autodesk.Revit.DB.UV(pt.X, pt.Y)
	elif type(pt) == Autodesk.DesignScript.Geometry.UV:
		return Autodesk.Revit.DB.UV(pt.U, pt.V)

def CreateSpaceTag(space, uv, view):
	doc = DocumentManager.Instance.CurrentDBDocument
	return doc.Create.NewSpaceTag(space, uv, view)

tagTypeId = toRvtId(tagType.Id)

locations = []

try:
	errorReport = None
	if RunIt:
		if tagType.Category.Name == "Room Tags":
			TransactionManager.Instance.EnsureInTransaction(doc)
			roomTags = []
			for v in views:
				subList = []
				roomTags.append(subList)
				for i, k in zip(elements, locationPts):
					roomId = LinkElementId(i.Id)
					location = Autodesk.Revit.DB.UV(toRvtPoint(k).X, toRvtPoint(k).Y)
					locations.append(location)
					roomTag = doc.Create.NewRoomTag(roomId, location, v.Id)
					roomTag.RoomTagType = tagType
					subList.append(roomTag)
			TransactionManager.Instance.TransactionTaskDone()
			result = roomTags
	else:
		result = "RunIt is set to False."
except:
	# if error accurs anywhere in the process catch it
	import traceback
	errorReport = traceback.format_exc()

#Assign your output to the OUT variable
if errorReport == None:
	OUT = result
else:
	OUT = errorReport
# ----------------------------------------
getLocation = Element.GetLocation(element=python_script_2)
categories = Categories(index=416)
all_elements_of_category = ElementsOfCategory(Category=categories)
select_model_element = DSModelElementSelection()  # 1 picked in the model

# group: Get all rooms
python_script_3 = Python()  # unwired: IN[0]
# ---------- python_script_3.python (54 lines) ----------
#Copyright(c) 2015, Konrad K Sobon
# @arch_laboratory, http://archi-lab.net

# Huge thanks to Andreas Dieckmann for 
# adding link path functionality

import clr
clr.AddReference('ProtoGeometry')
from Autodesk.DesignScript.Geometry import *

# Import DocumentManager and TransactionManager
clr.AddReference("RevitServices")
import RevitServices
from RevitServices.Persistence import DocumentManager
from RevitServices.Transactions import TransactionManager

from System.Collections.Generic import *

# Import RevitAPI
clr.AddReference("RevitAPI")
import Autodesk
from Autodesk.Revit.DB import *
from Autodesk.Revit.DB.Analysis import *

doc = DocumentManager.Instance.CurrentDBDocument
uiapp = DocumentManager.Instance.CurrentUIApplication
app = uiapp.Application

# Import ToDSType(bool) extension method
clr.AddReference("RevitNodes")
import Revit
clr.ImportExtensions(Revit.Elements)

#The inputs to this node will be stored as a list in the IN variable.
dataEnteringNode = IN

collector = Autodesk.Revit.DB.FilteredElementCollector(doc)
linkInstances = collector.OfClass(Autodesk.Revit.DB.RevitLinkInstance)

linkDoc = []

for i in linkInstances:
	subList = []
	subList.append(i.GetLinkDocument())
	subList.append(i)
	subList.append(i.Name)
	try:
		subList.append(i.GetLinkDocument().PathName)
	except:
		subList.append(None)
		pass
	linkDoc.append(subList)
	
OUT = linkDoc
# ----------------------------------------
code_block = CodeBlock(a=python_script_3) { a[0][0]; }
python_script_4 = Python(IN[0]=code_block)
# ---------- python_script_4.python (43 lines) ----------
#Copyright(c) 2015, Konrad Sobon
# @arch_laboratory, http://archi-lab.net

# This node is based on Julien Benoit's Element.GetElementFromLinkedFile 
# node. Some slight improvements were made removing unnecessary imports/references.
# Big thank you to Julien for sharing his work. 

import clr
clr.AddReference('ProtoGeometry')
from Autodesk.DesignScript.Geometry import *

# Import RevitAPI
clr.AddReference("RevitAPI")
import Autodesk
from Autodesk.Revit.DB import *

import System

import sys
pyt_path = r'C:\Program Files (x86)\IronPython 2.7\Lib'
sys.path.append(pyt_path)

#The inputs to this node will be stored as a list in the IN variable.
dataEnteringNode = IN

_linkDoc = IN[0]
#_category = IN[1]

try:
	errorReport = None
	#filter = ElementCategoryFilter(System.Enum.ToObject(BuiltInCategory, _category.Id))
	#result = FilteredElementCollector(_linkDoc).WherePasses(filter).WhereElementIsNotElementType().ToElements()
	result = FilteredElementCollector(_linkDoc).OfCategory(BuiltInCategory.OST_Rooms).WhereElementIsNotElementType().ToElements()
except:
	# if error accurs anywhere in the process catch it
	import traceback
	errorReport = traceback.format_exc()

#Assign your output to the OUT variable
if errorReport == None:
	OUT = result
else:
	OUT = errorReport
# ----------------------------------------

location = Room.Location(room=python_script_4)
family_types = FamilyTypes(index=2186)
categories_2 = Categories(index=587)
all_elements_of_category_2 = ElementsOfCategory(Category=categories_2)
viewTemplate = archilab.Revit.Views.Views.ViewTemplate()  # unwired: view
groupByFunction = List.GroupByFunction(list=all_elements_of_category_2, func=viewTemplate)
code_block_2 = CodeBlock(a=groupByFunction) { a[12]; }
code_block_3 = CodeBlock(a=python_script_3) { a[0][1]; }
run = BoolSelector(true)
python_script_5 = Python(IN[0]=location, IN[1]=family_types, IN[2]=python_script_4, IN[3]=code_block_2, IN[4]=code_block_3, IN[5]=run)
# ---------- python_script_5.python (105 lines) ----------
#Copyright(c) 2015, Konrad K Sobon
# @arch_laboratory, http://archi-lab.net

import clr
clr.AddReference('ProtoGeometry')
from Autodesk.DesignScript.Geometry import *

# Import Element wrapper extension methods
clr.AddReference("RevitNodes")
import Revit
clr.ImportExtensions(Revit.Elements)

# Import geometry conversion extension methods
clr.ImportExtensions(Revit.GeometryConversion)

# Import DocumentManager and TransactionManager
clr.AddReference("RevitServices")
import RevitServices
from RevitServices.Persistence import DocumentManager
from RevitServices.Transactions import TransactionManager

doc = DocumentManager.Instance.CurrentDBDocument
uiapp = DocumentManager.Instance.CurrentUIApplication
app = uiapp.Application

# Import RevitAPI
clr.AddReference("RevitAPI")
import Autodesk
from Autodesk.Revit.DB import *

import sys
pyt_path = r'C:\Program Files (x86)\IronPython 2.7\Lib'
sys.path.append(pyt_path)

#The inputs to this node will be stored as a list in the IN variable.
dataEnteringNode = IN

locationPts = UnwrapElement(IN[0])
tagType = UnwrapElement(IN[1])
elements = UnwrapElement(IN[2])

if IN[4] != None:
	link = UnwrapElement(IN[4])
else:
	link = None
	
RunIt = IN[5]

if isinstance(IN[3], list):
	views = [UnwrapElement(i) for i in IN[3]]
else:
	views = UnwrapElement(IN[3])

def toRvtPoint(point):
	return point.ToXyz()

def toRvtId(_id):
	if isinstance(_id, int) or isinstance(_id, str):
		id = ElementId(int(_id))
		return id
	elif isinstance(_id, ElementId):
		return _id

def GetUVPoint(pt):
	if type(pt) == Autodesk.DesignScript.Geometry.Point:
		return Autodesk.Revit.DB.UV(pt.X, pt.Y)
	elif type(pt) == Autodesk.DesignScript.Geometry.UV:
		return Autodesk.Revit.DB.UV(pt.U, pt.V)

def CreateSpaceTag(space, uv, view):
	doc = DocumentManager.Instance.CurrentDBDocument
	return doc.Create.NewSpaceTag(space, uv, view)

tagTypeId = toRvtId(tagType.Id)

try:
	errorReport = None
	if RunIt:
		if tagType.Category.Name == "Room Tags":
			TransactionManager.Instance.EnsureInTransaction(doc)
			roomTags = []
			for v in views:
				for i, j in zip(elements, locationPts):
					if link != None:
						roomId = LinkElementId(link.Id, i.Id)
					else:
						roomId = LinkElementId(i.Id)
					location = Autodesk.Revit.DB.UV(toRvtPoint(j).X, toRvtPoint(j).Y)
					roomTag = doc.Create.NewRoomTag(roomId, location, v.Id)
					roomTag.RoomTagType = tagType
					roomTags.append(roomTag)
			TransactionManager.Instance.TransactionTaskDone()
			result = roomTags
	else:
		result = "RunIt is set to False."
except:
	# if error accurs anywhere in the process catch it
	import traceback
	errorReport = traceback.format_exc()

#Assign your output to the OUT variable
if errorReport == None:
	OUT = result
else:
	OUT = errorReport
# ----------------------------------------
