# Dynamo graph tagLinkedRooms04.dyn (Dynamo 2.0.1.5055)

# group: Choose Tag Family
family_types = FamilyTypes()  # nothing selected
string = StringInput("Name only")
byName = FamilyType.ByName(name=string)

# group: Collects Rooms
python_script = Python()  # unwired: IN[0]
# ---------- python_script.python (54 lines) ----------
#Copyright(c) 2015, Konrad Sobon
# @arch_laboratory, http://archi-lab.net

# This node is based on Julien Benoit's Element.GetElementFromLinkedFile 
# node. Some slight improvements were made removing unnecessary imports/references.
# Big thank you to Julien for sharing his work. 

import clr
clr.AddReference('ProtoGeometry')
from Autodesk.DesignScript.Geometry import *

# Import DocumentManager and TransactionManager
clr.AddReference("RevitServices")
import RevitServices
from RevitServices.Persistence import DocumentManager
from RevitServices.Transactions import TransactionManager

# Import RevitAPI
clr.AddReference("RevitAPI")
import Autodesk
from Autodesk.Revit.DB import *

import System

import sys
pyt_path = r'C:\Program Files (x86)\IronPython 2.7\Lib'
sys.path.append(pyt_path)

#The inputs to this node will be stored as a list in the IN variable.

doc = DocumentManager.Instance.CurrentDBDocument

collector = Autodesk.Revit.DB.FilteredElementCollector(doc)
linkInstances = collector.OfClass(Autodesk.Revit.DB.RevitLinkInstance)

result = []
errorReport = []

for l in linkInstances:
	if l.GetLinkDocument():
		try:
			#filter = ElementCategoryFilter(System.Enum.ToObject(BuiltInCategory, _category.Id))
			#result = FilteredElementCollector(_linkDoc).WherePasses(filter).WhereElementIsNotElementType().ToElements()
			result.append(FilteredElementCollector(l.GetLinkDocument()).OfCategory(BuiltInCategory.OST_Rooms).WhereElementIsNotElementType().ToElements())
		except:
			# if error accurs anywhere in the process catch it
			import traceback
			errorReport.append(traceback.format_exc())

#Assign your output to the OUT variable
if not errorReport:
	OUT = result
else:
	OUT = errorReport
# ----------------------------------------

location = Room.Location(room=python_script, lacing=Longest)
isNull = Object.IsNull(obj=location)
filterByBoolMask = List.FilterByBoolMask(list=location, mask=isNull)
categories = Categories(index=587)
all_elements_of_category = ElementsOfCategory(Category=categories)
viewTemplate = archilab.Revit.Views.Views.ViewTemplate()  # unwired: view
groupByFunction = List.GroupByFunction(list=all_elements_of_category, func=viewTemplate)

# group: Select drawings
code_block = CodeBlock(allDrawings=groupByFunction) { allDrawings[26]; }

code_block_2 = CodeBlock(a=code_block) { [a[23]]; }
python_script_2 = Python(IN[0]=code_block_2)
# ---------- python_script_2.python (34 lines) ----------
import clr
clr.AddReference('ProtoGeometry')
from Autodesk.DesignScript.Geometry import *

# Import DocumentManager and TransactionManager
clr.AddReference("RevitServices")
import RevitServices
from RevitServices.Persistence import DocumentManager
from RevitServices.Transactions import TransactionManager

# Import RevitAPI
clr.AddReference("RevitAPI")
import Autodesk
from Autodesk.Revit.DB import *

clr.AddReference("RevitNodes")
import Revit
# Import ToProtoType, ToRevitType geometry conversion extension methods
clr.ImportExtensions(Revit.GeometryConversion)


view = UnwrapElement(IN[0])

#b = view[0].get_BoundingBox(None);
cbox = view[0].CropBox


max = XYZ(cbox.Max.X,cbox.Max.Y,cbox.Max.Z+cbox.Transform.Origin.Z+1000/304.8)
min = XYZ(cbox.Min.X,cbox.Min.Y,cbox.Transform.Origin.Z)

cbox.Max = max
cbox.Min = min

OUT = cbox.ToProtoType()
# ----------------------------------------
contains = BoundingBox.Contains(boundingBox=python_script_2, point=filterByBoolMask.out)
filterByBoolMask_2 = List.FilterByBoolMask(list=filterByBoolMask.out, mask=contains)
filterByBoolMask_3 = List.FilterByBoolMask(list=python_script, mask=isNull)
filterByBoolMask_4 = List.FilterByBoolMask(list=filterByBoolMask_3.out, mask=contains)

# group: Collect Link Instances
python_script_3 = Python()  # unwired: IN[0]
# ---------- python_script_3.python (54 lines) ----------
#Copyright(c) 2015, Konrad Sobon
# @arch_laboratory, http://archi-lab.net

# This node is based on Julien Benoit's Element.GetElementFromLinkedFile 
# node. Some slight improvements were made removing unnecessary imports/references.
# Big thank you to Julien for sharing his work. 

import clr
clr.AddReference('ProtoGeometry')
from Autodesk.DesignScript.Geometry import *

# Import DocumentManager and TransactionManager
clr.AddReference("RevitServices")
import RevitServices
from RevitServices.Persistence import DocumentManager
from RevitServices.Transactions import TransactionManager

# Import RevitAPI
clr.AddReference("RevitAPI")
import Autodesk
from Autodesk.Revit.DB import *

import System

import sys
pyt_path = r'C:\Program Files (x86)\IronPython 2.7\Lib'
sys.path.append(pyt_path)

#The inputs to this node will be stored as a list in the IN variable.

doc = DocumentManager.Instance.CurrentDBDocument

collector = Autodesk.Revit.DB.FilteredElementCollector(doc)
linkInstances = collector.OfClass(Autodesk.Revit.DB.RevitLinkInstance)

result = []
errorReport = []

for l in linkInstances:
	if l.GetLinkDocument():
		try:
			#filter = ElementCategoryFilter(System.Enum.ToObject(BuiltInCategory, _category.Id))
			#result = FilteredElementCollector(_linkDoc).WherePasses(filter).WhereElementIsNotElementType().ToElements()
			result.append(l)
		except:
			# if error accurs anywhere in the process catch it
			import traceback
			errorReport.append(traceback.format_exc())

#Assign your output to the OUT variable
if not errorReport:
	OUT = result
else:
	OUT = errorReport
# ----------------------------------------

run = BoolSelector(true)

# group: from Archilab
create_annotation_tag = Custom[Create Annotation Tag]()  # This node will create an annotation tag at a given location, of given type and in a supplied view. If only single view is supplied then all tags will be created in that view.; unwired: TagLocations, TagType, Elements, Views
python_script_4 = Python(IN[0]=filterByBoolMask_2.in, IN[1]=byName, IN[2]=filterByBoolMask_4.in, IN[3]=code_block_2, IN[4]=python_script_3, IN[5]=run)  # frozen
# ---------- python_script_4.python (108 lines) ----------
#Copyright(c) 2015, Konrad K Sobon
# @arch_laboratory, http://archi-lab.net

import clr
clr.AddReference('ProtoGeometry')
from Autodesk.DesignScript.Geometry import *

# Import Element wrapper extension methods
clr.AddReference("RevitNodes")
import Revit
clr.ImportExtensions(Revit.Elements)

# Import geometry conversion extension methods
clr.ImportExtensions(Revit.GeometryConversion)

# Import DocumentManager and TransactionManager
clr.AddReference("RevitServices")
import RevitServices
from RevitServices.Persistence import DocumentManager
from RevitServices.Transactions import TransactionManager

doc = DocumentManager.Instance.CurrentDBDocument
uiapp = DocumentManager.Instance.CurrentUIApplication
app = uiapp.Application

# Import RevitAPI
clr.AddReference("RevitAPI")
import Autodesk
from Autodesk.Revit.DB import *

import sys
pyt_path = r'C:\Program Files (x86)\IronPython 2.7\Lib'
sys.path.append(pyt_path)



locationPtList = UnwrapElement(IN[0])
tagType = UnwrapElement(IN[1])
elementList = UnwrapElement(IN[2])

linkList = UnwrapElement(IN[4])
	
RunIt = IN[5]

if isinstance(IN[3], list):
	viewList = [UnwrapElement(i) for i in IN[3]]
else:
	viewList = UnwrapElement(IN[3])

def toRvtPoint(point):
	return point.ToXyz()

def toRvtId(_id):
	if isinstance(_id, int) or isinstance(_id, str):
		id = ElementId(int(_id))
		return id
	elif isinstance(_id, ElementId):
		return _id

def GetUVPoint(pt):
	if type(pt) == Autodesk.DesignScript.Geometry.Point:
		return Autodesk.Revit.DB.UV(pt.X, pt.Y)
	elif type(pt) == Autodesk.DesignScript.Geometry.UV:
		return Autodesk.Revit.DB.UV(pt.U, pt.V)

def CreateSpaceTag(space, uv, view):
	doc = DocumentManager.Instance.CurrentDBDocument
	return doc.Create.NewSpaceTag(space, uv, view)

tagTypeId = toRvtId(tagType.Id)

def PlaceRoomTags(views, elements, locationPts, link):
	roomTags = []
	for v in views:
		for i, j in zip(elements, locationPts):
			if link != None:
				roomId = LinkElementId(link.Id, i.Id)
			else:
				roomId = LinkElementId(i.Id)
			location = Autodesk.Revit.DB.UV(toRvtPoint(j).X, toRvtPoint(j).Y)
			roomTag = doc.Create.NewRoomTag(roomId, location, v.Id)
			roomTag.RoomTagType = tagType
			roomTags.append(roomTag)
	return roomTags



try:
	errorReport = None
	if RunIt:
		if tagType.Category.Name == "Room Tags":
			TransactionManager.Instance.EnsureInTransaction(doc)			
			result = []
			for i in range(0, len(elementList)):
				result.append(PlaceRoomTags(viewList, elementList[i], locationPtList[i], linkList[i]))
			TransactionManager.Instance.TransactionTaskDone()
	else:
		result = "RunIt is set to False."
except:
	# if error accurs anywhere in the process catch it
	import traceback
	errorReport = traceback.format_exc()

#Assign your output to the OUT variable
if errorReport == None:
	OUT = result
else:
	OUT = errorReport
# ----------------------------------------

code_block_3 = CodeBlock { 0; }
getItemAtIndex = List.GetItemAtIndex(list=groupByFunction, index=code_block_3, lacing=Longest)
viewTemplate_2 = archilab.Revit.Views.Views.ViewTemplate(view=getItemAtIndex)
countTrue = List.CountTrue(list=contains, lacing=Longest)
code_block_4 = CodeBlock { "Level"; }
getParameterValueByName = Element.GetParameterValueByName(element=python_script, parameterName=code_block_4)
python_script_5 = Python(IN[0]=code_block_2, IN[1]=python_script)
# ---------- python_script_5.python (34 lines) ----------
import clr
clr.AddReference('RevitAPI')
from Autodesk.Revit.DB import *

clr.AddReference("RevitNodes")
import Revit
clr.ImportExtensions(Revit.Elements)

def GetLevel(item):
	val = None
	if hasattr(item, "LevelId"): 
		val = item.Document.GetElement(item.LevelId)
		if val: return val
	if hasattr(item, "Level"):
		val = item.Level
		if val: return val
	if hasattr(item, "GenLevel"):
		val = item.GenLevel
		if val: return val
	if not val:
		try: return item.Document.GetElement(item.get_Parameter(BuiltInParameter.INSTANCE_REFERENCE_LEVEL_PARAM).AsElementId())
		except: 
			try: return item.Document.GetElement(item.get_Parameter(BuiltInParameter.INSTANCE_SCHEDULE_ONLY_LEVEL_PARAM).AsElementId())
			except: return None

level = UnwrapElement(IN[0])
rooms = UnwrapElement(IN[1])

result = []




OUT = GetLevel(level[0]).Elevation
# ----------------------------------------
allIndicesOf = List.AllIndicesOf(item=python_script_5)  # unwired: list
getItemAtIndex_2 = List.GetItemAtIndex(list=python_script, index=allIndicesOf)
