# Dynamo graph tagLinkedRooms05.dyn (Dynamo 2.0.1.5055)

get_documents = Custom[Get Documents]()  # Queries all linked Revit files and retrieves their Name, LinkInstance and Document properties.
code_block = CodeBlock(a=get_documents.Link_Doc) { a[0]; }
categories = Categories(index=602)
all_elements_of_category = ElementsOfCategory(Category=categories)
viewTemplate = archilab.Revit.Views.Views.ViewTemplate()  # unwired: view
groupByFunction = List.GroupByFunction(list=all_elements_of_category, func=viewTemplate)

# group: Select drawings
code_block_2 = CodeBlock(allDrawings=groupByFunction) { allDrawings[0]; }

code_block_3 = CodeBlock(a=code_block_2) { [a[0]]; }
categories_2 = Categories(index=425)
inHostViewAndCategory = Custom[GetLinkedElement.InHostViewAndCategory](LinkDoc=code_block, views=code_block_3, Categories=categories_2)  # Gets linked elements in host view, filtered by category.
location = Room.Location(room=inHostViewAndCategory)

# group: Choose Tag Family
family_types = FamilyTypes(index=4)
string = StringInput("Name only")
byName = FamilyType.ByName(name=string)

# group: Collect Link Instances
python_script = Python()  # unwired: IN[0]
# ---------- python_script.python (54 lines) ----------
#Copyright(c) 2015, Konrad Sobon
# @arch_laboratory, http://archi-lab.net

# This node is based on Julien Benoit's Element.GetElementFromLinkedFile 
# node. Some slight improvements were made removing unnecessary imports/references.
# Big thank you to Julien for sharing his work. 

import clr
clr.AddReference('ProtoGeometry')
from Autodesk.DesignScript.Geometry import *

# Import DocumentManager and TransactionManager
clr.AddReference("RevitServices")
import RevitServices
from RevitServices.Persistence import DocumentManager
from RevitServices.Transactions import TransactionManager

# Import RevitAPI
clr.AddReference("RevitAPI")
import Autodesk
from Autodesk.Revit.DB import *

import System

import sys
pyt_path = r'C:\Program Files (x86)\IronPython 2.7\Lib'
sys.path.append(pyt_path)

#The inputs to this node will be stored as a list in the IN variable.

doc = DocumentManager.Instance.CurrentDBDocument

collector = Autodesk.Revit.DB.FilteredElementCollector(doc)
linkInstances = collector.OfClass(Autodesk.Revit.DB.RevitLinkInstance)

result = []
errorReport = []

for l in linkInstances:
	if l.GetLinkDocument():
		try:
			#filter = ElementCategoryFilter(System.Enum.ToObject(BuiltInCategory, _category.Id))
			#result = FilteredElementCollector(_linkDoc).WherePasses(filter).WhereElementIsNotElementType().ToElements()
			result.append(l)
		except:
			# if error accurs anywhere in the process catch it
			import traceback
			errorReport.append(traceback.format_exc())

#Assign your output to the OUT variable
if not errorReport:
	OUT = result
else:
	OUT = errorReport
# ----------------------------------------

run = BoolSelector(true)

# group: Collects Rooms
python_script_2 = Python()  # unwired: IN[0]
# ---------- python_script_2.python (54 lines) ----------
#Copyright(c) 2015, Konrad Sobon
# @arch_laboratory, http://archi-lab.net

# This node is based on Julien Benoit's Element.GetElementFromLinkedFile 
# node. Some slight improvements were made removing unnecessary imports/references.
# Big thank you to Julien for sharing his work. 

import clr
clr.AddReference('ProtoGeometry')
from Autodesk.DesignScript.Geometry import *

# Import DocumentManager and TransactionManager
clr.AddReference("RevitServices")
import RevitServices
from RevitServices.Persistence import DocumentManager
from RevitServices.Transactions import TransactionManager

# Import RevitAPI
clr.AddReference("RevitAPI")
import Autodesk
from Autodesk.Revit.DB import *

import System

import sys
pyt_path = r'C:\Program Files (x86)\IronPython 2.7\Lib'
sys.path.append(pyt_path)

#The inputs to this node will be stored as a list in the IN variable.

doc = DocumentManager.Instance.CurrentDBDocument

collector = Autodesk.Revit.DB.FilteredElementCollector(doc)
linkInstances = collector.OfClass(Autodesk.Revit.DB.RevitLinkInstance)

result = []
errorReport = []

for l in linkInstances:
	if l.GetLinkDocument():
		try:
			#filter = ElementCategoryFilter(System.Enum.ToObject(BuiltInCategory, _category.Id))
			#result = FilteredElementCollector(_linkDoc).WherePasses(filter).WhereElementIsNotElementType().ToElements()
			result.append(FilteredElementCollector(l.GetLinkDocument()).OfCategory(BuiltInCategory.OST_Rooms).WhereElementIsNotElementType().ToElements())
		except:
			# if error accurs anywhere in the process catch it
			import traceback
			errorReport.append(traceback.format_exc())

#Assign your output to the OUT variable
if not errorReport:
	OUT = result
else:
	OUT = errorReport
# ----------------------------------------

python_script_3 = Python(IN[0]=code_block_3, IN[1]=python_script_2)  # frozen
# ---------- python_script_3.python (42 lines) ----------
import clr
clr.AddReference('RevitAPI')
from Autodesk.Revit.DB import *

clr.AddReference("RevitNodes")
import Revit
clr.ImportExtensions(Revit.Elements)

def GetLevel(item):
	val = None
	if hasattr(item, "LevelId"): 
		val = item.Document.GetElement(item.LevelId)
		if val: return val
	if hasattr(item, "Level"):
		val = item.Level
		if val: return val
	if hasattr(item, "GenLevel"):
		val = item.GenLevel
		if val: return val
	if not val:
		try: return item.Document.GetElement(item.get_Parameter(BuiltInParameter.INSTANCE_REFERENCE_LEVEL_PARAM).AsElementId())
		except: 
			try: return item.Document.GetElement(item.get_Parameter(BuiltInParameter.INSTANCE_SCHEDULE_ONLY_LEVEL_PARAM).AsElementId())
			except: return None

level = UnwrapElement(IN[0])
rooms = UnwrapElement(IN[1])

result = []

for r in rooms:
	subList = []
	result.append(subList)
	for i in r:
		try:
			dist = abs(i.Location.Point.Z - GetLevel(level[0]).Elevation)
			if dist<1000/304.8:
				subList.append(i)
		except:
			continue
			
OUT = result
# ----------------------------------------
location_2 = Room.Location(room=python_script_3, lacing=Longest)

# group: from Archilab
create_annotation_tag = Custom[Create Annotation Tag](TagLocations=location, TagType=family_types, Elements=inHostViewAndCategory, Views=code_block_3, LinkInstance=python_script, RunIt=run)  # This node will create an annotation tag at a given location, of given type and in a supplied view. If only single view is supplied then all tags will be created in that view.
python_script_4 = Python(IN[0]=location_2, IN[1]=byName, IN[2]=python_script_3, IN[3]=code_block_3, IN[4]=python_script, IN[5]=run)
# ---------- python_script_4.python (108 lines) ----------
#Copyright(c) 2015, Konrad K Sobon
# @arch_laboratory, http://archi-lab.net

import clr
clr.AddReference('ProtoGeometry')
from Autodesk.DesignScript.Geometry import *

# Import Element wrapper extension methods
clr.AddReference("RevitNodes")
import Revit
clr.ImportExtensions(Revit.Elements)

# Import geometry conversion extension methods
clr.ImportExtensions(Revit.GeometryConversion)

# Import DocumentManager and TransactionManager
clr.AddReference("RevitServices")
import RevitServices
from RevitServices.Persistence import DocumentManager
from RevitServices.Transactions import TransactionManager

doc = DocumentManager.Instance.CurrentDBDocument
uiapp = DocumentManager.Instance.CurrentUIApplication
app = uiapp.Application

# Import RevitAPI
clr.AddReference("RevitAPI")
import Autodesk
from Autodesk.Revit.DB import *

import sys
pyt_path = r'C:\Program Files (x86)\IronPython 2.7\Lib'
sys.path.append(pyt_path)



locationPtList = UnwrapElement(IN[0])
tagType = UnwrapElement(IN[1])
elementList = UnwrapElement(IN[2])

linkList = UnwrapElement(IN[4])
	
RunIt = IN[5]

if isinstance(IN[3], list):
	viewList = [UnwrapElement(i) for i in IN[3]]
else:
	viewList = UnwrapElement(IN[3])

def toRvtPoint(point):
	return point.ToXyz()

def toRvtId(_id):
	if isinstance(_id, int) or isinstance(_id, str):
		id = ElementId(int(_id))
		return id
	elif isinstance(_id, ElementId):
		return _id

def GetUVPoint(pt):
	if type(pt) == Autodesk.DesignScript.Geometry.Point:
		return Autodesk.Revit.DB.UV(pt.X, pt.Y)
	elif type(pt) == Autodesk.DesignScript.Geometry.UV:
		return Autodesk.Revit.DB.UV(pt.U, pt.V)

def CreateSpaceTag(space, uv, view):
	doc = DocumentManager.Instance.CurrentDBDocument
	return doc.Create.NewSpaceTag(space, uv, view)

tagTypeId = toRvtId(tagType.Id)

def PlaceRoomTags(views, elements, locationPts, link):
	roomTags = []
	for v in views:
		for i, j in zip(elements, locationPts):
			if link != None:
				roomId = LinkElementId(link.Id, i.Id)
			else:
				roomId = LinkElementId(i.Id)
			location = Autodesk.Revit.DB.UV(toRvtPoint(j).X, toRvtPoint(j).Y)
			roomTag = doc.Create.NewRoomTag(roomId, location, v.Id)
			roomTag.RoomTagType = tagType
			roomTags.append(roomTag)
	return roomTags



try:
	errorReport = None
	if RunIt:
		if tagType.Category.Name == "Room Tags":
			TransactionManager.Instance.EnsureInTransaction(doc)			
			result = []
			for i in range(0, len(elementList)):
				result.append(PlaceRoomTags(viewList, elementList[i], locationPtList[i], linkList[i]))
			TransactionManager.Instance.TransactionTaskDone()
	else:
		result = "RunIt is set to False."
except:
	# if error accurs anywhere in the process catch it
	import traceback
	errorReport = traceback.format_exc()

#Assign your output to the OUT variable
if errorReport == None:
	OUT = result
else:
	OUT = errorReport
# ----------------------------------------

code_block_4 = CodeBlock { 0; }
getItemAtIndex = List.GetItemAtIndex(list=groupByFunction, index=code_block_4, lacing=Longest)
viewTemplate_2 = archilab.Revit.Views.Views.ViewTemplate(view=getItemAtIndex)
python_script_5 = Python()  # unwired: IN[0]
# ---------- python_script_5.python (34 lines) ----------
import clr
clr.AddReference('ProtoGeometry')
from Autodesk.DesignScript.Geometry import *

# Import DocumentManager and TransactionManager
clr.AddReference("RevitServices")
import RevitServices
from RevitServices.Persistence import DocumentManager
from RevitServices.Transactions import TransactionManager

# Import RevitAPI
clr.AddReference("RevitAPI")
import Autodesk
from Autodesk.Revit.DB import *

clr.AddReference("RevitNodes")
import Revit
# Import ToProtoType, ToRevitType geometry conversion extension methods
clr.ImportExtensions(Revit.GeometryConversion)


view = UnwrapElement(IN[0])

#b = view[0].get_BoundingBox(None);
cbox = view[0].CropBox


max = XYZ(cbox.Max.X,cbox.Max.Y,cbox.Max.Z+cbox.Transform.Origin.Z+1000/304.8)
min = XYZ(cbox.Min.X,cbox.Min.Y,cbox.Transform.Origin.Z)

cbox.Max = max
cbox.Min = min

OUT = cbox.ToProtoType()
# ----------------------------------------
python_script_6 = Python(IN[0]=code_block_3, IN[1]=python_script_2)
# ---------- python_script_6.python (40 lines) ----------
import clr
clr.AddReference('RevitAPI')
from Autodesk.Revit.DB import *

clr.AddReference("RevitNodes")
import Revit
clr.ImportExtensions(Revit.Elements)

def GetLevel(item):
	val = None
	if hasattr(item, "LevelId"): 
		val = item.Document.GetElement(item.LevelId)
		if val: return val
	if hasattr(item, "Level"):
		val = item.Level
		if val: return val
	if hasattr(item, "GenLevel"):
		val = item.GenLevel
		if val: return val
	if not val:
		try: return item.Document.GetElement(item.get_Parameter(BuiltInParameter.INSTANCE_REFERENCE_LEVEL_PARAM).AsElementId())
		except: 
			try: return item.Document.GetElement(item.get_Parameter(BuiltInParameter.INSTANCE_SCHEDULE_ONLY_LEVEL_PARAM).AsElementId())
			except: return None

level = UnwrapElement(IN[0])
rooms = UnwrapElement(IN[1])

result = []

for r in rooms:
	subList = []
	result.append(subList)
	for i in r:
		try:
			subList.append(i.Location.Point)
		except:
			continue
			
OUT = result
# ----------------------------------------
location_3 = Room.Location(room=python_script_2, lacing=Longest)
python_script_7 = Python(IN[0]=code_block_3)
# ---------- python_script_7.python (47 lines) ----------
import clr
clr.AddReference('RevitAPI')
from Autodesk.Revit.DB import *

clr.AddReference("RevitNodes")
import Revit
clr.ImportExtensions(Revit.GeometryConversion)

clr.AddReference("RevitServices")
import RevitServices
from RevitServices.Persistence import DocumentManager
from RevitServices.Transactions import TransactionManager

doc = DocumentManager.Instance.CurrentDBDocument
v = UnwrapElement(IN[0])[0]

#getting project base point elevation
basepointfilter = ElementCategoryFilter(BuiltInCategory.OST_ProjectBasePoint)
basepoint = FilteredElementCollector(doc).WherePasses(basepointfilter).ToElements()
bpelevation = [b.ParametersMap.get_Item('Elev').AsDouble() for b in basepoint]

bb = v.CropBox
vr = v.GetViewRange()
topclip = PlanViewPlane.TopClipPlane
bottomclip = PlanViewPlane.BottomClipPlane
cutclip = PlanViewPlane.CutPlane
toplevel = (doc.GetElement(vr.GetLevelId(topclip)))
topoffset = vr.GetOffset(topclip)
cutlevel = (doc.GetElement(vr.GetLevelId(cutclip)))
cutoffset = vr.GetOffset(cutclip)
try:
	topZ = toplevel.Elevation + topoffset - bpelevation[0]
except:
	topZ = cutlevel.Elevation + cutoffset - bpelevation[0]
bottomlevel = (doc.GetElement(vr.GetLevelId(bottomclip)))
bottomoffset = vr.GetOffset(bottomclip)
try:
	bottomZ = bottomlevel.Elevation + bottomoffset - bpelevation[0]
except :
	bottomZ = cutlevel.Elevation - bpelevation[0]
min = bb.Min
max = bb.Max
newmin = XYZ(min.X,min.Y,bottomZ)
newmax = XYZ(max.X,max.Y,topZ)
ol = Outline(newmin,newmax)
	
OUT = newmin.ToPoint(), newmax.ToPoint(), (cutoffset*304.8)
# ----------------------------------------
contains = BoundingBox.Contains(boundingBox=python_script_7, point=location_3)
filterByBoolMask = List.FilterByBoolMask(list=location_3, mask=contains)
byStartPointEndPoint = Line.ByStartPointEndPoint()  # unwired: startPoint, endPoint
byCurve = ModelCurve.ByCurve(curve=byStartPointEndPoint)
code_block_5 = CodeBlock(a=byStartPointEndPoint) { [a]; }
code_block_6 = CodeBlock(a=code_block_3) { a[0]; }
python_script_8 = Python(IN[0]=code_block_5, IN[1]=code_block_6)
# ---------- python_script_8.python (28 lines) ----------
import clr
clr.AddReference('RevitAPI')
from Autodesk.Revit.DB import *

clr.AddReference("RevitNodes")
import Revit
clr.ImportExtensions(Revit.GeometryConversion)

clr.AddReference("RevitServices")
import RevitServices
from RevitServices.Persistence import DocumentManager
from RevitServices.Transactions import TransactionManager

doc = DocumentManager.Instance.CurrentDBDocument
curves = UnwrapElement(IN[0])
view = UnwrapElement(IN[1])
elementlist = []

TransactionManager.Instance.EnsureInTransaction(doc)
if doc.IsFamilyDocument: 
	doc_create = doc.FamilyCreate
else: 
	doc_create = doc.Create
for curve in curves:
	detcurve = doc_create.NewDetailCurve(view, curve.ToRevitType())
	elementlist.append(detcurve)
TransactionManager.Instance.TransactionTaskDone()
OUT = elementlist
# ----------------------------------------
inHostView = Custom[GetLinkedElement.InHostView](LinkDoc=code_block)  # Gets linked elements in host view(s).; unwired: HostView
select_model_element = DSModelElementSelection()  # 1 picked in the model
code_block_7 = CodeBlock(a=select_model_element) { Element.GetLocation(a); }
python_script_9 = Python()  # unwired: IN[0], IN[1], IN[2], IN[3]
# ---------- python_script_9.python (80 lines) ----------
#Copyright (c) mostafa el ayoubi ,  2017
#Data-Shapes www.data-shapes.net , elayoubi.mostafa@gmail.com

import clr
clr.AddReference('RevitAPI')
from Autodesk.Revit.DB import*
clr.AddReference('RevitServices')
from RevitServices.Persistence import DocumentManager
doc = DocumentManager.Instance.CurrentDBDocument
import System
from System.Collections.Generic import *

clr.AddReference('ProtoGeometry')
from Autodesk.DesignScript.Geometry import*
doc = DocumentManager.Instance.CurrentDBDocument

#Inputs
if isinstance(IN[2],list):
	categories = IN[2]
else:
	categories = [UnwrapElement(IN[2])]
linkdoc = IN[1]
if isinstance(IN[0],list):
	views = UnwrapElement(IN[0])
else:
	views = [UnwrapElement(IN[0])]

collector = []

#getting project base point elevation
basepointfilter = ElementCategoryFilter(BuiltInCategory.OST_ProjectBasePoint)
basepoint = FilteredElementCollector(doc).WherePasses(basepointfilter).ToElements()
bpelevation = [b.ParametersMap.get_Item('Elev').AsDouble() for b in basepoint]

#Category filter
catfilter = []
for i in categories:
	catfilter.append(ElementCategoryFilter(System.Enum.ToObject(BuiltInCategory, int(str(i.Id)))))

catfilterlist = List[ElementFilter](catfilter)
filter = LogicalOrFilter(catfilterlist)

UIunit = Document.GetUnits(doc).GetFormatOptions(UnitType.UT_Length).DisplayUnits
level = []
for v in views:

	#creating a boundingbox for each view from it's crop box and view range
	bb = v.CropBox
	vr = v.GetViewRange()
	topclip = PlanViewPlane.TopClipPlane
	bottomclip = PlanViewPlane.BottomClipPlane
	cutclip = PlanViewPlane.CutPlane
	toplevel = (doc.GetElement(vr.GetLevelId(topclip)))
	topoffset = vr.GetOffset(topclip)
	cutlevel = (doc.GetElement(vr.GetLevelId(cutclip)))
	cutoffset = vr.GetOffset(cutclip)
	try:
		topZ = toplevel.Elevation + topoffset - bpelevation[0]
	except:
		topZ = cutlevel.Elevation + cutoffset - bpelevation[0]
	bottomlevel = (doc.GetElement(vr.GetLevelId(bottomclip)))
	bottomoffset = vr.GetOffset(bottomclip)
	try:
		bottomZ = bottomlevel.Elevation + bottomoffset - bpelevation[0]
	except :
		bottomZ = cutlevel.Elevation - bpelevation[0]
	min = bb.Min
	max = bb.Max
	newmin = XYZ(min.X,min.Y,bottomZ)
	newmax = XYZ(max.X,max.Y,topZ)
	ol = Outline(newmin,newmax)

	#combining boundingbox and category filters
	bbfilter = BoundingBoxIntersectsFilter(ol)
	andfilter = LogicalAndFilter(filter,bbfilter)

	#collecting elements
	collector.append(FilteredElementCollector(linkdoc).WherePasses(andfilter).ToElements())

OUT = collector
# ----------------------------------------
code_block_8 = CodeBlock(a=python_script_7) { a[2]; }
translate = Geometry.Translate(geometry=location, zTranslation=code_block_8)
python_script_10 = Python(IN[0]=location, IN[1]=family_types, IN[2]=inHostViewAndCategory, IN[3]=code_block_3, IN[4]=python_script, IN[5]=run)  # same code as python_script_4
