# Dynamo graph tagLinkedRooms06.dyn (Dynamo 2.0.1.5055)

# group: Choose Tag Family
family_types = FamilyTypes(index=4)
string = StringInput("Name only")
byName = FamilyType.ByName(name=string)

# group: Collect Views
python_script = Python()  # unwired: IN[0]
# ---------- python_script.python (35 lines) ----------
import clr
clr.AddReference('ProtoGeometry')
from Autodesk.DesignScript.Geometry import *

# Import DocumentManager and TransactionManager
clr.AddReference("RevitServices")
import RevitServices
from RevitServices.Persistence import DocumentManager
from RevitServices.Transactions import TransactionManager

# Import RevitAPI
clr.AddReference("RevitAPI")
import Autodesk
from Autodesk.Revit.DB import *

import System

import sys
pyt_path = r'C:\Program Files (x86)\IronPython 2.7\Lib'
sys.path.append(pyt_path)

#The inputs to this node will be stored as a list in the IN variable.

doc = DocumentManager.Instance.CurrentDBDocument

collector = Autodesk.Revit.DB.FilteredElementCollector(doc)
views = collector.OfClass(View).WhereElementIsNotElementType().ToElements()

result = []
for v in views:
	if v.ViewTemplateId != None:
		result.append(v)
	

OUT = result
# ----------------------------------------

viewTemplate = archilab.Revit.Views.Views.ViewTemplate()  # unwired: view
groupByFunction = List.GroupByFunction(list=python_script, func=viewTemplate)
code_block = CodeBlock { 0; }
getItemAtIndex = List.GetItemAtIndex(list=groupByFunction, index=code_block, lacing=Longest)
viewTemplate_2 = archilab.Revit.Views.Views.ViewTemplate(view=getItemAtIndex)

# group: Collect Link Instances
python_script_2 = Python()  # unwired: IN[0]
# ---------- python_script_2.python (54 lines) ----------
#Copyright(c) 2015, Konrad Sobon
# @arch_laboratory, http://archi-lab.net

# This node is based on Julien Benoit's Element.GetElementFromLinkedFile 
# node. Some slight improvements were made removing unnecessary imports/references.
# Big thank you to Julien for sharing his work. 

import clr
clr.AddReference('ProtoGeometry')
from Autodesk.DesignScript.Geometry import *

# Import DocumentManager and TransactionManager
clr.AddReference("RevitServices")
import RevitServices
from RevitServices.Persistence import DocumentManager
from RevitServices.Transactions import TransactionManager

# Import RevitAPI
clr.AddReference("RevitAPI")
import Autodesk
from Autodesk.Revit.DB import *

import System

import sys
pyt_path = r'C:\Program Files (x86)\IronPython 2.7\Lib'
sys.path.append(pyt_path)

#The inputs to this node will be stored as a list in the IN variable.

doc = DocumentManager.Instance.CurrentDBDocument

collector = Autodesk.Revit.DB.FilteredElementCollector(doc)
linkInstances = collector.OfClass(Autodesk.Revit.DB.RevitLinkInstance)

result = []
errorReport = []

for l in linkInstances:
	if l.GetLinkDocument():
		try:
			#filter = ElementCategoryFilter(System.Enum.ToObject(BuiltInCategory, _category.Id))
			#result = FilteredElementCollector(_linkDoc).WherePasses(filter).WhereElementIsNotElementType().ToElements()
			result.append(l)
		except:
			# if error accurs anywhere in the process catch it
			import traceback
			errorReport.append(traceback.format_exc())

#Assign your output to the OUT variable
if not errorReport:
	OUT = result
else:
	OUT = errorReport
# ----------------------------------------

# group: Select drawings
code_block_2 = CodeBlock(allDrawings=groupByFunction) { allDrawings[29]; }

code_block_3 = CodeBlock(a=code_block_2) { [a[4]]; }
python_script_3 = Python(IN[0]=code_block_3)
# ---------- python_script_3.python (21 lines) ----------
import clr
clr.AddReference('RevitAPI')
from Autodesk.Revit.DB import *

clr.AddReference("RevitNodes")
import Revit
clr.ImportExtensions(Revit.GeometryConversion)

clr.AddReference("RevitServices")
import RevitServices
from RevitServices.Persistence import DocumentManager
from RevitServices.Transactions import TransactionManager

doc = DocumentManager.Instance.CurrentDBDocument
v = UnwrapElement(IN[0])[0]

vr = v.GetViewRange()
cutclip = PlanViewPlane.CutPlane
cutoffset = vr.GetOffset(cutclip)
	
OUT = v.Origin.Z + cutoffset
# ----------------------------------------
code_block_4 = CodeBlock(a=python_script_3) { a[3]; }
categories = Categories(index=416)
code_block_5 = CodeBlock { 1; }
python_script_4 = Python(IN[0]=code_block_2, IN[1]=categories, IN[2]=code_block_5)
# ---------- python_script_4.python (107 lines) ----------
#Copyright (c) mostafa el ayoubi ,  2017
#Data-Shapes www.data-shapes.net , elayoubi.mostafa@gmail.com

import clr
clr.AddReference('RevitAPI')
from Autodesk.Revit.DB import*
clr.AddReference('RevitServices')
from RevitServices.Persistence import DocumentManager
doc = DocumentManager.Instance.CurrentDBDocument
import System
from System.Collections.Generic import *

clr.AddReference('ProtoGeometry')
from Autodesk.DesignScript.Geometry import*
doc = DocumentManager.Instance.CurrentDBDocument

#Inputs
if isinstance(IN[1],list):
	categories = IN[1]
else:
	categories = [UnwrapElement(IN[1])]


if isinstance(IN[0],list):
	views = UnwrapElement(IN[0])
else:
	views = [UnwrapElement(IN[0])]



linkInstances = FilteredElementCollector(doc).OfClass(RevitLinkInstance)
linkDocs = []

for l in linkInstances:
	if l.GetLinkDocument():
		try:
			#filter = ElementCategoryFilter(System.Enum.ToObject(BuiltInCategory, _category.Id))
			#result = FilteredElementCollector(_linkDoc).WherePasses(filter).WhereElementIsNotElementType().ToElements()
			linkDocs.append(l.GetLinkDocument())
		except:
			continue
			
#getting project base point elevation
basepointfilter = ElementCategoryFilter(BuiltInCategory.OST_ProjectBasePoint)
basepoint = FilteredElementCollector(doc).WherePasses(basepointfilter).ToElements()
bpelevation = [b.ParametersMap.get_Item('Elev').AsDouble() for b in basepoint]

#Category filter
catfilter = []
for i in categories:
	catfilter.append(ElementCategoryFilter(System.Enum.ToObject(BuiltInCategory, int(str(i.Id)))))

catfilterlist = List[ElementFilter](catfilter)
filter = LogicalOrFilter(catfilterlist)

UIunit = Document.GetUnits(doc).GetFormatOptions(UnitType.UT_Length).DisplayUnits

def FindRoomsInView(views, linkInstance):
	collector = []
	if l.GetLinkDocument():
		linkdoc = linkInstance.GetLinkDocument()
		level = []
		for v in views:
			#creating a boundingbox for each view from it's crop box and view range
			bb = v.CropBox
			vr = v.GetViewRange()
			topclip = PlanViewPlane.TopClipPlane
			bottomclip = PlanViewPlane.BottomClipPlane
			cutclip = PlanViewPlane.CutPlane
			toplevel = (doc.GetElement(vr.GetLevelId(topclip)))
			topoffset = vr.GetOffset(topclip)
			cutlevel = (doc.GetElement(vr.GetLevelId(cutclip)))
			cutoffset = vr.GetOffset(cutclip)
			try:
				topZ = toplevel.Elevation + topoffset - bpelevation[0]
			except:
				topZ = cutlevel.Elevation + cutoffset - bpelevation[0]
			bottomlevel = (doc.GetElement(vr.GetLevelId(bottomclip)))
			bottomoffset = vr.GetOffset(bottomclip)
			try:
				bottomZ = bottomlevel.Elevation + bottomoffset - bpelevation[0]
			except :
				bottomZ = cutlevel.Elevation - bpelevation[0]
			min = bb.Min
			max = bb.Max
			newmin = XYZ(min.X,min.Y,bottomZ)
			newmax = XYZ(max.X,max.Y,topZ)
			ol = Outline(newmin,newmax)
		
			#combining boundingbox and category filters
			bbfilter = BoundingBoxIntersectsFilter(ol)
			andfilter = LogicalAndFilter(filter,bbfilter)
		
			#collecting elements
			fecRooms = FilteredElementCollector(linkdoc).WherePasses(andfilter).ToElements()
			if fecRooms:
				collector.append([v, linkInstance, fecRooms])
	return collector

result = []

for l in linkInstances:
	fiv = FindRoomsInView(views, l)
	if fiv:
		result.append(fiv)

OUT = result
# ----------------------------------------
code_block_6 = CodeBlock(a=python_script_4) { a[0][2]; }
code_block_7 = CodeBlock(a=code_block_6) { a[0]; a[1]; a[2]; }
python_script_5 = Python(IN[0]=code_block_7.out2, IN[1]=code_block_7.out0)
# ---------- python_script_5.python (44 lines) ----------
#Copyright(c) 2015, Konrad Sobon
# @arch_laboratory, http://archi-lab.net

# This node is based on Julien Benoit's Element.GetElementFromLinkedFile 
# node. Some slight improvements were made removing unnecessary imports/references.
# Big thank you to Julien for sharing his work. 

import clr
clr.AddReference('ProtoGeometry')
from Autodesk.DesignScript.Geometry import *

# Import DocumentManager and TransactionManager
clr.AddReference("RevitServices")
import RevitServices
from RevitServices.Persistence import DocumentManager
from RevitServices.Transactions import TransactionManager

# Import RevitAPI
clr.AddReference("RevitAPI")
import Autodesk
from Autodesk.Revit.DB import *

import System

import sys
pyt_path = r'C:\Program Files (x86)\IronPython 2.7\Lib'
sys.path.append(pyt_path)

#The inputs to this node will be stored as a list in the IN variable.

doc = DocumentManager.Instance.CurrentDBDocument

elements = UnwrapElement(IN[0])
v = UnwrapElement(IN[1])



def RoomPointOnView(room,view):
	vr = v.GetViewRange()
	cutclip = PlanViewPlane.CutPlane
	cutoffset = vr.GetOffset(cutclip)	
	return XYZ(room.Location.Point.X,room.Location.Point.Y,v.Origin.Z + cutoffset)

OUT = [RoomPointOnView(e, v) for e in elements]
# ----------------------------------------
run = BoolSelector(true)
python_script_6 = Python(IN[0]=python_script_5, IN[1]=byName, IN[2]=code_block_7.out2, IN[3]=code_block_7.out0, IN[4]=code_block_7.out1, IN[5]=run)
# ---------- python_script_6.python (106 lines) ----------
#Copyright(c) 2015, Konrad K Sobon
# @arch_laboratory, http://archi-lab.net

import clr
clr.AddReference('ProtoGeometry')
from Autodesk.DesignScript.Geometry import *

# Import Element wrapper extension methods
clr.AddReference("RevitNodes")
import Revit
clr.ImportExtensions(Revit.Elements)

# Import geometry conversion extension methods
clr.ImportExtensions(Revit.GeometryConversion)

# Import DocumentManager and TransactionManager
clr.AddReference("RevitServices")
import RevitServices
from RevitServices.Persistence import DocumentManager
from RevitServices.Transactions import TransactionManager

doc = DocumentManager.Instance.CurrentDBDocument
uiapp = DocumentManager.Instance.CurrentUIApplication
app = uiapp.Application

# Import RevitAPI
clr.AddReference("RevitAPI")
import Autodesk
from Autodesk.Revit.DB import *

import sys
pyt_path = r'C:\Program Files (x86)\IronPython 2.7\Lib'
sys.path.append(pyt_path)



locationPtList = UnwrapElement(IN[0])
tagType = UnwrapElement(IN[1])
elementList = UnwrapElement(IN[2])

linkList = UnwrapElement(IN[4])
	
RunIt = IN[5]

if isinstance(IN[3], list):
	viewList = [UnwrapElement(i) for i in IN[3]]
else:
	viewList = UnwrapElement(IN[3])

def toRvtPoint(point):
	return point.ToXyz()

def toRvtId(_id):
	if isinstance(_id, int) or isinstance(_id, str):
		id = ElementId(int(_id))
		return id
	elif isinstance(_id, ElementId):
		return _id

def GetUVPoint(pt):
	if type(pt) == Autodesk.DesignScript.Geometry.Point:
		return Autodesk.Revit.DB.UV(pt.X, pt.Y)
	elif type(pt) == Autodesk.DesignScript.Geometry.UV:
		return Autodesk.Revit.DB.UV(pt.U, pt.V)

def CreateSpaceTag(space, uv, view):
	doc = DocumentManager.Instance.CurrentDBDocument
	return doc.Create.NewSpaceTag(space, uv, view)

tagTypeId = toRvtId(tagType.Id)

def PlaceRoomTags(view, elements, locationPts, link):
	roomTags = []
	for i, j in zip(elements, locationPts):
		if link != None:
			roomId = LinkElementId(link.Id, i.Id)
		else:
			roomId = LinkElementId(i.Id)
		location = Autodesk.Revit.DB.UV(toRvtPoint(j).X, toRvtPoint(j).Y)
		roomTag = doc.Create.NewRoomTag(roomId, location, view.Id)
		roomTag.RoomTagType = tagType
		roomTags.append(roomTag)
	return roomTags



try:
	errorReport = None
	if RunIt:
		if tagType.Category.Name == "Room Tags":
			TransactionManager.Instance.EnsureInTransaction(doc)
			result = []			
			result.append(PlaceRoomTags(viewList, elementList, locationPtList, linkList))
			TransactionManager.Instance.TransactionTaskDone()
	else:
		result = "RunIt is set to False."
except:
	# if error accurs anywhere in the process catch it
	import traceback
	errorReport = traceback.format_exc()

#Assign your output to the OUT variable
if errorReport == None:
	OUT = result
else:
	OUT = errorReport
# ----------------------------------------
viewTemplate_3 = archilab.Revit.Views.Views.ViewTemplate(view=groupByFunction)

# group: Collect Link docs
python_script_7 = Python()  # unwired: IN[0]
# ---------- python_script_7.python (56 lines) ----------
#Copyright(c) 2015, Konrad Sobon
# @arch_laboratory, http://archi-lab.net

# This node is based on Julien Benoit's Element.GetElementFromLinkedFile 
# node. Some slight improvements were made removing unnecessary imports/references.
# Big thank you to Julien for sharing his work. 

import clr
clr.AddReference('ProtoGeometry')
from Autodesk.DesignScript.Geometry import *

# Import DocumentManager and TransactionManager
clr.AddReference("RevitServices")
import RevitServices
from RevitServices.Persistence import DocumentManager
from RevitServices.Transactions import TransactionManager

# Import RevitAPI
clr.AddReference("RevitAPI")
import Autodesk
from Autodesk.Revit.DB import *

import System

import sys
pyt_path = r'C:\Program Files (x86)\IronPython 2.7\Lib'
sys.path.append(pyt_path)

#The inputs to this node will be stored as a list in the IN variable.

doc = DocumentManager.Instance.CurrentDBDocument

collector = Autodesk.Revit.DB.FilteredElementCollector(doc)
linkInstances = collector.OfClass(Autodesk.Revit.DB.RevitLinkInstance)

result = []
errorReport = []
linkDoc = []

for l in linkInstances:
	if l.GetLinkDocument():
		try:
			#filter = ElementCategoryFilter(System.Enum.ToObject(BuiltInCategory, _category.Id))
			#result = FilteredElementCollector(_linkDoc).WherePasses(filter).WhereElementIsNotElementType().ToElements()
			linkDoc.append(l.GetLinkDocument())
			result.append(l)
		except:
			# if error accurs anywhere in the process catch it
			import traceback
			errorReport.append(traceback.format_exc())

#Assign your output to the OUT variable
if not errorReport:
	OUT = linkDoc
else:
	OUT = errorReport
# ----------------------------------------

code_block_8 = CodeBlock(a=python_script_3) { a[0]; a[1]; }
byCorners = BoundingBox.ByCorners(min=code_block_8.out0, max=code_block_8.out1)

# group: Collects Rooms
python_script_8 = Python()  # unwired: IN[0]
# ---------- python_script_8.python (54 lines) ----------
#Copyright(c) 2015, Konrad Sobon
# @arch_laboratory, http://archi-lab.net

# This node is based on Julien Benoit's Element.GetElementFromLinkedFile 
# node. Some slight improvements were made removing unnecessary imports/references.
# Big thank you to Julien for sharing his work. 

import clr
clr.AddReference('ProtoGeometry')
from Autodesk.DesignScript.Geometry import *

# Import DocumentManager and TransactionManager
clr.AddReference("RevitServices")
import RevitServices
from RevitServices.Persistence import DocumentManager
from RevitServices.Transactions import TransactionManager

# Import RevitAPI
clr.AddReference("RevitAPI")
import Autodesk
from Autodesk.Revit.DB import *

import System

import sys
pyt_path = r'C:\Program Files (x86)\IronPython 2.7\Lib'
sys.path.append(pyt_path)

#The inputs to this node will be stored as a list in the IN variable.

doc = DocumentManager.Instance.CurrentDBDocument

collector = Autodesk.Revit.DB.FilteredElementCollector(doc)
linkInstances = collector.OfClass(Autodesk.Revit.DB.RevitLinkInstance)

result = []
errorReport = []

for l in linkInstances:
	if l.GetLinkDocument():
		try:
			#filter = ElementCategoryFilter(System.Enum.ToObject(BuiltInCategory, _category.Id))
			#result = FilteredElementCollector(_linkDoc).WherePasses(filter).WhereElementIsNotElementType().ToElements()
			result.append(FilteredElementCollector(l.GetLinkDocument()).OfCategory(BuiltInCategory.OST_Rooms).WhereElementIsNotElementType().ToElements())
		except:
			# if error accurs anywhere in the process catch it
			import traceback
			errorReport.append(traceback.format_exc())

#Assign your output to the OUT variable
if not errorReport:
	OUT = result
else:
	OUT = errorReport
# ----------------------------------------

code_block_9 = CodeBlock(a=python_script_8) { a[1]; }
boundingBox = Element.BoundingBox(element=code_block_9)
clear_list = Custom[Clear List](Input=boundingBox)  # This node will remove all Null and Empty Lists from any list.
intersects = BoundingBox.Intersects(boundingBox=byCorners, other=clear_list)
create_annotation_tag = Custom[Create Annotation Tag]()  # This node will create an annotation tag at a given location, of given type and in a supplied view. If only single view is supplied then all tags will be created in that view.; unwired: TagLocations, TagType, Elements, Views
python_script_9 = Python(IN[0]=code_block_6)
# ---------- python_script_9.python (14 lines) ----------
# Enable Python support and load DesignScript library
import clr
clr.AddReference('ProtoGeometry')
from Autodesk.DesignScript.Geometry import *

# The inputs to this node will be stored as a list in the IN variables.
dataEnteringNode = IN

list = IN[0]
# Assign your output to the OUT variable.
if not list:
	OUT = 'cio'
else:
	OUT = 'no'
# ----------------------------------------
code_block_10 = CodeBlock(a=python_script_4) { a[0][0]; }
select_model_element = DSModelElementSelection()  # 1 picked in the model
getLocation = Element.GetLocation(element=select_model_element)
name = Element.Name(element=groupByFunction)
code_block_11 = CodeBlock { "E - LEVEL 02 Distribution Layout - Low Level"; }
allIndicesOf = List.AllIndicesOf(list=name, item=code_block_11, lacing=Longest)
location = Room.Location(room=code_block_7.out2)
byOriginNormal = Plane.ByOriginNormal()
translate = Geometry.Translate(geometry=byOriginNormal, zTranslation=python_script_3)
code_block_12 = CodeBlock { Vector.ZAxis(); }
project = Point.Project(point=location, baseGeometry=translate, projectionDirection=code_block_12, lacing=Longest)
flatten = List.Flatten(list=project)
