# Dynamo graph tagLinkedRooms08.dyn (Dynamo 2.0.1.5055)

# group: Collect Views
python_script = Python()  # unwired: IN[0]
# ---------- python_script.python (35 lines) ----------
import clr
clr.AddReference('ProtoGeometry')
from Autodesk.DesignScript.Geometry import *

# Import DocumentManager and TransactionManager
clr.AddReference("RevitServices")
import RevitServices
from RevitServices.Persistence import DocumentManager
from RevitServices.Transactions import TransactionManager

# Import RevitAPI
clr.AddReference("RevitAPI")
import Autodesk
from Autodesk.Revit.DB import *

import System

import sys
pyt_path = r'C:\Program Files (x86)\IronPython 2.7\Lib'
sys.path.append(pyt_path)

#The inputs to this node will be stored as a list in the IN variable.

doc = DocumentManager.Instance.CurrentDBDocument

collector = Autodesk.Revit.DB.FilteredElementCollector(doc)
views = collector.OfClass(View).WhereElementIsNotElementType().ToElements()

result = []
for v in views:
	if v.ViewTemplateId != None:
		result.append(v)
	

OUT = result
# ----------------------------------------

viewTemplate = archilab.Revit.Views.Views.ViewTemplate()  # unwired: view
groupByFunction = List.GroupByFunction(list=python_script, func=viewTemplate)

# group: Select drawings
code_block = CodeBlock(allDrawings=groupByFunction) { allDrawings[27]; }

# group: Choose Tag Family
family_types = FamilyTypes(index=4)
string = StringInput("Name only")
byName = FamilyType.ByName(name=string)

# group: All plan and ceiling views on sheet
python_script_2 = Python()
# ---------- python_script_2.python (48 lines) ----------
import clr
clr.AddReference('ProtoGeometry')
from Autodesk.DesignScript.Geometry import *

# Import DocumentManager and TransactionManager
clr.AddReference("RevitServices")
import RevitServices
from RevitServices.Persistence import DocumentManager
from RevitServices.Transactions import TransactionManager

# Import RevitAPI
clr.AddReference("RevitAPI")
import Autodesk
from Autodesk.Revit.DB import *


#The inputs to this node will be stored as a list in the IN variable.
def GetParVal(element, paramName):
	value = ""
	for p in element.Parameters:
		if p.Definition.Name == paramName:
			value= p.AsString()
	return value
	
doc = DocumentManager.Instance.CurrentDBDocument

collector = Autodesk.Revit.DB.FilteredElementCollector(doc)
views = collector.OfClass(ViewPlan).WhereElementIsNotElementType().ToElements()

result = []
errors = []


for v in views:
	sheetNumber = GetParVal(v, "Sheet Number")
	if v.ViewType.ToString() != "FloorPlan" and v.ViewType.ToString() != "CeilingPlan":
		errors.append(v.Name + " *not a floor or ceiling plan*")
	else:
		if len(sheetNumber)<3 :
			errors.append(v.Name + " *not on sheet*")
		else:
			if v.IsTemplate == False and v.ViewTemplateId != None:
				result.append(v)
			else:
				errors.append(v.Name)


OUT = result, errors
# ----------------------------------------

code_block_2 = CodeBlock(a=python_script_2) { a[0]; }
refresh = BoolSelector(false)
python_script_3 = Python(IN[0]=code_block_2, IN[1]=refresh)
# ---------- python_script_3.python (112 lines) ----------
#Copyright (c) mostafa el ayoubi ,  2017
#Data-Shapes www.data-shapes.net , elayoubi.mostafa@gmail.com

import clr
clr.AddReference('RevitAPI')
from Autodesk.Revit.DB import*
clr.AddReference('RevitServices')
from RevitServices.Persistence import DocumentManager
doc = DocumentManager.Instance.CurrentDBDocument
import System
from System.Collections.Generic import *

clr.AddReference('ProtoGeometry')
from Autodesk.DesignScript.Geometry import*
doc = DocumentManager.Instance.CurrentDBDocument

if isinstance(IN[0],list):
	views = UnwrapElement(IN[0])
else:
	views = [UnwrapElement(IN[0])]

cat = doc.Settings.Categories

categories  = [x for x in cat if x.Name == "Rooms"]

linkInstances = FilteredElementCollector(doc).OfClass(RevitLinkInstance)
linkDocs = []

for l in linkInstances:
	if l.GetLinkDocument():
		try:
			#filter = ElementCategoryFilter(System.Enum.ToObject(BuiltInCategory, _category.Id))
			#result = FilteredElementCollector(_linkDoc).WherePasses(filter).WhereElementIsNotElementType().ToElements()
			linkDocs.append(l.GetLinkDocument())
		except:
			continue
			
#getting project base point elevation
basepointfilter = ElementCategoryFilter(BuiltInCategory.OST_ProjectBasePoint)
basepoint = FilteredElementCollector(doc).WherePasses(basepointfilter).ToElements()
bpelevation = [b.ParametersMap.get_Item('Elev').AsDouble() for b in basepoint]

#Category filter
catfilter = []
for i in categories:
	catfilter.append(ElementCategoryFilter(System.Enum.ToObject(BuiltInCategory, int(str(i.Id)))))

catfilterlist = List[ElementFilter](catfilter)
filter = LogicalOrFilter(catfilterlist)

UIunit = Document.GetUnits(doc).GetFormatOptions(UnitType.UT_Length).DisplayUnits

errors = []

def FindRoomsInView(views, linkInstance):
	collector = []
	suberrors = []
	if l.GetLinkDocument():
		linkdoc = linkInstance.GetLinkDocument()
		level = []
		for v in views:
			try:
				#creating a boundingbox for each view from it's crop box and view range
				bb = v.CropBox
				vr = v.GetViewRange()
				topclip = PlanViewPlane.TopClipPlane
				bottomclip = PlanViewPlane.BottomClipPlane
				cutclip = PlanViewPlane.CutPlane
				toplevel = (doc.GetElement(vr.GetLevelId(topclip)))
				topoffset = vr.GetOffset(topclip)
				cutlevel = (doc.GetElement(vr.GetLevelId(cutclip)))
				cutoffset = vr.GetOffset(cutclip)
				try:
					topZ = toplevel.Elevation + topoffset - bpelevation[0]
				except:
					topZ = cutlevel.Elevation + cutoffset - bpelevation[0]
				bottomlevel = (doc.GetElement(vr.GetLevelId(bottomclip)))
				bottomoffset = vr.GetOffset(bottomclip)
				try:
					bottomZ = bottomlevel.Elevation + bottomoffset - bpelevation[0]
				except :
					bottomZ = cutlevel.Elevation - bpelevation[0]
				min = bb.Min
				max = bb.Max
				newmin = XYZ(min.X,min.Y,bottomZ)
				newmax = XYZ(max.X,max.Y,topZ)
				ol = Outline(newmin,newmax)
			
				#combining boundingbox and category filters
				bbfilter = BoundingBoxIntersectsFilter(ol)
				andfilter = LogicalAndFilter(filter,bbfilter)
			
				#collecting elements
				fecRooms = FilteredElementCollector(linkdoc).WherePasses(andfilter).ToElements()
				if fecRooms:
					collector.append([v, linkInstance, fecRooms])
			except:
				suberrors.append(v.Name)
	return [collector, suberrors]

result = []
errors = []
for l in linkInstances:
	fiv = FindRoomsInView(views, l)
	if fiv[0]:
		result.extend(fiv[0])
	else:
		errors.append(fiv[1])



OUT = result, errors
# ----------------------------------------
code_block_3 = CodeBlock(a=python_script_3) { a[0]; }
run = BoolSelector(true)
python_script_4 = Python(IN[0]=byName, IN[1]=code_block_3, IN[2]=run)
# ---------- python_script_4.python (120 lines) ----------
#Copyright(c) 2015, Konrad K Sobon
# @arch_laboratory, http://archi-lab.net

import clr
clr.AddReference('ProtoGeometry')
from Autodesk.DesignScript.Geometry import *

# Import Element wrapper extension methods
clr.AddReference("RevitNodes")
import Revit
clr.ImportExtensions(Revit.Elements)

# Import geometry conversion extension methods
clr.ImportExtensions(Revit.GeometryConversion)

# Import DocumentManager and TransactionManager
clr.AddReference("RevitServices")
import RevitServices
from RevitServices.Persistence import DocumentManager
from RevitServices.Transactions import TransactionManager

doc = DocumentManager.Instance.CurrentDBDocument
uiapp = DocumentManager.Instance.CurrentUIApplication
app = uiapp.Application

# Import RevitAPI
clr.AddReference("RevitAPI")
import Autodesk
from Autodesk.Revit.DB import *

import sys
pyt_path = r'C:\Program Files (x86)\IronPython 2.7\Lib'
sys.path.append(pyt_path)




tagType = UnwrapElement(IN[0])

listAll = IN[1]

RunIt = IN[2]



def toRvtPoint(point):
	return point.ToXyz()

def toRvtId(_id):
	if isinstance(_id, int) or isinstance(_id, str):
		id = ElementId(int(_id))
		return id
	elif isinstance(_id, ElementId):
		return _id

def GetUVPoint(pt):
	if type(pt) == Autodesk.DesignScript.Geometry.Point:
		return Autodesk.Revit.DB.UV(pt.X, pt.Y)
	elif type(pt) == Autodesk.DesignScript.Geometry.UV:
		return Autodesk.Revit.DB.UV(pt.U, pt.V)

def CreateSpaceTag(space, uv, view):
	doc = DocumentManager.Instance.CurrentDBDocument
	return doc.Create.NewSpaceTag(space, uv, view)

tagTypeId = toRvtId(tagType.Id)

def RoomPointOnView(room,view):
	try:
		vr = view.GetViewRange()
		cutclip = PlanViewPlane.CutPlane
		cutoffset = vr.GetOffset(cutclip)	
		return XYZ(room.Location.Point.X,room.Location.Point.Y,view.Origin.Z + cutoffset)
	except:
		return XYZ(0,0,0)


def PlaceRoomTags(view, elements, link):
	roomTags = []
	for i in elements:
		if link != None:
			roomId = LinkElementId(link.Id, i.Id)
		else:
			roomId = LinkElementId(i.Id)
		roomPoint = RoomPointOnView(i, view)
		location = Autodesk.Revit.DB.UV(roomPoint.X, roomPoint.Y)
		roomTag = doc.Create.NewRoomTag(roomId, location, view.Id)
		roomTag.RoomTagType = tagType
		roomTags.append(roomTag)
	return roomTags



try:
	errorReport = None
	if RunIt:
		if tagType.Category.Name == "Room Tags":
			TransactionManager.Instance.EnsureInTransaction(doc)
			result = []
			for l in listAll:
				try:
					elementList = UnwrapElement(l[2])
					linkList = UnwrapElement(l[1])
					viewList = UnwrapElement(l[0])
					result.append(PlaceRoomTags(viewList, elementList, linkList))
				except:
					result.append("error")
			TransactionManager.Instance.TransactionTaskDone()
	else:
		result = "RunIt is set to False."
except:
	# if error accurs anywhere in the process catch it
	import traceback
	errorReport = traceback.format_exc()

#Assign your output to the OUT variable
if errorReport == None:
	OUT = result
else:
	OUT = errorReport
# ----------------------------------------
create_annotation_tag = Custom[Create Annotation Tag]()  # This node will create an annotation tag at a given location, of given type and in a supplied view. If only single view is supplied then all tags will be created in that view.; unwired: TagLocations, TagType, Elements, Views
code_block_4 = CodeBlock(a=python_script_2) { a[1]; }

# group: errors - view names
code_block_5 = CodeBlock(a=python_script_3) { a[1]; }

python_script_5 = Python()  # unwired: IN[0]
# ---------- python_script_5.python (42 lines) ----------
import clr
clr.AddReference('ProtoGeometry')
from Autodesk.DesignScript.Geometry import *

# Import DocumentManager and TransactionManager
clr.AddReference("RevitServices")
import RevitServices
from RevitServices.Persistence import DocumentManager
from RevitServices.Transactions import TransactionManager

# Import RevitAPI
clr.AddReference("RevitAPI")
import Autodesk
from Autodesk.Revit.DB import *

def GetParVal(element, paramName):
	value = ""
	for p in element.Parameters:
		if p.Definition.Name == paramName:
			value= p.AsString()
	return value

#The inputs to this node will be stored as a list in the IN variable.

doc = DocumentManager.Instance.CurrentDBDocument

collector = Autodesk.Revit.DB.FilteredElementCollector(doc)
views = collector.OfClass(ViewPlan).WhereElementIsNotElementType().ToElements()

result = []
errors = []


for v in views:
	if v.IsTemplate == False and v.ViewTemplateId != None and v.ViewType.ToString() == "FloorPlan" or v.ViewType.ToString() == "CeilingPlan":
		result.append(v)
	else:
		errors.append(v.Name)

sn = [GetParVal(r, "Sheet Number") for r in result]

OUT = 
# ----------------------------------------
