# Dynamo graph targetView.dyn (Dynamo 2.0.1.4955)

select_model_element = DSModelElementSelection()  # 1 picked in the model
parameters = Element.Parameters(element=select_model_element)
parameterType = Parameter.ParameterType(parameter=parameters)
code_block = CodeBlock { "Target view"; }
views = Views(index=101)
setParameterByName = Element.SetParameterByName(element=select_model_element, parameterName=code_block, value=views)
storageType = Parameter.StorageType(parameter=parameters)
views_2 = Views(index=113)
python_script = Python(IN[0]=views, IN[1]=views_2)
# ---------- python_script.python (42 lines) ----------
import clr

clr.AddReference('RevitAPI')
from Autodesk.Revit.DB import *
from Autodesk.Revit.DB.Structure import *

clr.AddReference('RevitAPIUI')
from Autodesk.Revit.UI import *

clr.AddReference('System')
from System.Collections.Generic import List

clr.AddReference('RevitNodes')
import Revit
clr.ImportExtensions(Revit.GeometryConversion)
clr.ImportExtensions(Revit.Elements)

clr.AddReference('RevitServices')
import RevitServices
from RevitServices.Persistence import DocumentManager
from RevitServices.Transactions import TransactionManager

doc = DocumentManager.Instance.CurrentDBDocument
uidoc=DocumentManager.Instance.CurrentUIApplication.ActiveUIDocument

#Preparing input from dynamo to revit
newViewRef = UnwrapElement(IN[0])
ref = UnwrapElement(IN[1])

ids = List[ElementId]()

ids.Add(doc.ActiveView.Id)
ids.Add(ref.Id)
#Do some action in a Transaction
TransactionManager.Instance.EnsureInTransaction(doc)

#ReferenceableViewUtils.GetReferencedView(doc, ids[1])
#ReferenceableViewUtils.ChangeReferencedView(doc, ids[0],ids[1])

TransactionManager.Instance.TransactionTaskDone()

OUT = ids[0], ids[1].GetType()
# ----------------------------------------
code_block_2 = CodeBlock { 0; }
code_block_3 = CodeBlock { "REFERENCE_VIEWER_TARGET_VIEW"; }
select_model_element_2 = DSModelElementSelection()  # 1 picked in the model
code_block_4 = CodeBlock(a=select_model_element_2) { [a]; }
code_block_5 = CodeBlock { [5]; }

# group: archilab
set_builtin_parameter = Custom[Set BuiltIn Parameter](ParameterName=code_block_3, Elements=code_block_4, ParameterValues=code_block_5)  # This node will take an input of a built in parameter name and set that parameter to given value for given elements.

python_script_2 = Python()  # unwired: IN[0], IN[1]
# ---------- python_script_2.python (109 lines) ----------
#Copyright(c) 2015, Konrad K Sobon
# @arch_laboratory, http://archi-lab.net

import clr
import sys
clr.AddReference('ProtoGeometry')
from Autodesk.DesignScript.Geometry import *

pyt_path = r'C:\Program Files (x86)\IronPython 2.7\Lib'
sys.path.append(pyt_path)

# Import Element wrapper extension methods
clr.AddReference("RevitNodes")
import Revit
clr.ImportExtensions(Revit.Elements)

# Import DocumentManager and TransactionManager
clr.AddReference("RevitServices")
import RevitServices
from RevitServices.Persistence import DocumentManager
from RevitServices.Transactions import TransactionManager

doc = DocumentManager.Instance.CurrentDBDocument
uiapp = DocumentManager.Instance.CurrentUIApplication
app = uiapp.Application

# Import RevitAPI
clr.AddReference("RevitAPI")
import Autodesk
from Autodesk.Revit.DB import *
import System

#The inputs to this node will be stored as a list in the IN variable.
dataEnteringNode = IN

paramNames = IN[0]

if isinstance(IN[1], list):
	sheets = []
	for i in IN[1]:
		sheets.append(UnwrapElement(i))
else:
	sheets = IN[1]

elements = []
for i in sheets:
	elements.append(UnwrapElement(i))

def ProcessList(_func, _list):
    return map( lambda x: ProcessList(_func, x) if type(x)==list else _func(x), _list )

def ProcessListArg(_func, _list, _arg):
    return map( lambda x: ProcessListArg(_func, x, _arg) if type(x)==list else _func(x, _arg), _list )

def GetBuiltInParam(paramName):
	builtInParams = System.Enum.GetValues(BuiltInParameter)
	test = []
	for i in builtInParams:
		if i.ToString() == paramName:
			test.append(i)
			break
		else:
			continue
	return test[0]

def GetBipValue(element, bip):
	doc = DocumentManager.Instance.CurrentDBDocument
	value = None
	try:
		tempValue = element.get_Parameter(bip)
	except:
		tempValue = None
		pass
	if tempValue != None:
		if element.get_Parameter(bip).StorageType == StorageType.String:
			value = element.get_Parameter(bip).AsString()
		elif element.get_Parameter(bip).StorageType == StorageType.Integer:
			value  = element.get_Parameter(bip).AsInteger()
		elif element.get_Parameter(bip).StorageType == StorageType.Double:
			value = element.get_Parameter(bip).AsDouble()
		elif element.get_Parameter(bip).StorageType == StorageType.ElementId:
			id = element.get_Parameter(bip).AsElementId()
			value = doc.GetElement(id)
		return value
	else:
		return None

try:
	errorReport = None
	paramValues = []
	if isinstance(paramNames, list):
		builtInParams = ProcessList(GetBuiltInParam, paramNames)
		for i in builtInParams:
			paramValues.append(ProcessListArg(GetBipValue, elements, i))
	else:
		builtInParams = GetBuiltInParam(paramNames)
		if isinstance(sheets, list):
			for sheet in sheets:
				paramValues.append(GetBipValue(sheet, builtInParams))
except:
	# if error accurs anywhere in the process catch it
	import traceback
	errorReport = traceback.format_exc()

#Assign your output to the OUT variable
if errorReport == None:
	OUT = paramValues
else:
	OUT = errorReport
# ----------------------------------------
get_built_in_parameter = Custom[Get Built In Parameter](ParameterNames=code_block_3, Elements=code_block_4)  # This node will take an input of a built in parameter name and element to return that parameters value.
python_script_3 = Python()  # unwired: IN[0], IN[1], IN[2]
# ---------- python_script_3.python (69 lines) ----------
#Copyright(c) 2017, Konrad K Sobon
# @arch_laboratory, http://archi-lab.net

import clr
import sys
pyt_path = r'C:\Program Files (x86)\IronPython 2.7\Lib'
sys.path.append(pyt_path)

# Import Element wrapper extension methods
clr.AddReference("RevitNodes")
import Revit
clr.ImportExtensions(Revit.Elements)

# Import DocumentManager and TransactionManager
clr.AddReference("RevitServices")
import RevitServices
from RevitServices.Persistence import DocumentManager
from RevitServices.Transactions import TransactionManager
doc = DocumentManager.Instance.CurrentDBDocument

# Import RevitAPI
clr.AddReference("RevitAPI")
import Autodesk
from Autodesk.Revit.DB import *
import System

paramName = IN[0]
paramValues = IN[2]

if not isinstance(IN[1], list):
	elements = [IN[1]]
else:
	elements = IN[1]

def GetBuiltInParam(paramName):
	builtInParams = System.Enum.GetValues(BuiltInParameter)
	test = []
	for i in builtInParams:
		if i.ToString() == paramName:
			test.append(i)
			break
		else:
			continue
	return test[0]

try:
	errorReport = None
	TransactionManager.Instance.EnsureInTransaction(doc)
	
	bipName = GetBuiltInParam(paramName)
	for i, j in zip(elements, paramValues):
		param = UnwrapElement(i).get_Parameter(bipName)
		if param.StorageType == StorageType.ElementId:
			id = ElementId(j)
			param.Set(id)
		else:
			param.Set(j)
	
	TransactionManager.Instance.TransactionTaskDone()
except:
	# if error accurs anywhere in the process catch it
	import traceback
	errorReport = traceback.format_exc()

#Assign your output to the OUT variable
if errorReport == None:
	OUT = IN[1]
else:
	OUT = errorReport
# ----------------------------------------
code_block_6 = CodeBlock { "REFERENCE_OTHER_VIEW_UI_TOGGLE"; }
getParameterValueByName = Element.GetParameterValueByName(element=select_model_element, parameterName=code_block)
