# Dynamo graph teklaBeam.dyn (Dynamo 2.0.1.4955)

select_model_elements = DSModelElementsSelection()  # 70 picked in the model; graph input

# group: CREATE MULTIPLE BEAMS
code_block = CodeBlock { "Type"; }
getParameterValueByName = Element.GetParameterValueByName(element=select_model_elements, parameterName=code_block, lacing=CrossProduct)
code_block_2 = CodeBlock { "Steel_Undefined"; }

name = Element.Name(element=getParameterValueByName)
code_block_3 = CodeBlock { "UC"; }
split = String.Split(str=name, separater0=code_block_3)
count = List.Count(list=split, lacing=Longest)
code_block_4 = CodeBlock { 2; }
eq = count == code_block_4  # lacing=Longest
filterByBoolMask = List.FilterByBoolMask(list=select_model_elements, mask=eq)

# group (continued): CREATE MULTIPLE BEAMS
location = StructuralFraming.Location(structuralFraming=filterByBoolMask.in)

curves = Element.Curves(element=select_model_elements)
byJoinedCurves = PolyCurve.ByJoinedCurves(curves=curves)
endPoint = Curve.EndPoint(curve=byJoinedCurves)
startPoint = Curve.StartPoint(curve=byJoinedCurves)
byStartPointEndPoint = Line.ByStartPointEndPoint(startPoint=endPoint, endPoint=startPoint)
code_block_5 = CodeBlock { "250UC*73"; }
id = Element.Id(element=select_model_elements)
string_from_object = FromObject(obj=id)
overallPosition = Arup.DynaTekla.Positions.OverallPosition()
genericBeam = Arup.DynaTekla.TeklaSteel.GenericBeam(crv=byStartPointEndPoint, Size=code_block_5, Name=string_from_object, Position=overallPosition, Material=code_block_2)
filterByBoolMask_2 = List.FilterByBoolMask(list=split, mask=eq)
code_block_6 = CodeBlock(a=filterByBoolMask_2.in) { a; }
firstItem = List.FirstItem(list=code_block_6, lacing=Longest)
lastItem = List.LastItem(list=code_block_6, lacing=Longest)
toNumber = String.ToNumber(str=lastItem)
round = Math.Round(number=toNumber)
python_script = Python(IN[0]=round)
# ---------- python_script.python (1 lines) ----------
OUT = [str(int(a)) for a in IN[0]]
# ----------------------------------------
code_block_7 = CodeBlock(a=code_block_3, b=firstItem, c=python_script) { a+b+"*"+c; }
string_from_object_2 = FromObject()  # unwired: obj
beam2Pt = Arup.DynaTekla.TeklaSteel.Beam2Pt()  # unwired: StPt, EndPt
