# Dynamo graph tendons.dyn (Dynamo 2.0.1.4955)

code_block = CodeBlock { point1 = Autodesk.Point.ByCoordinates(0, 0, 0); }
speckle_streams = Streams(RestApi="http://speckle.arup.digital/api/v1", Email="giovanni.brogiolo@arup.com", Server="undefined", StreamId="BJktkOEEX", Transmitting=false)
anonymous_stream = Receiver(ID=speckle_streams, DocumentName="tendons", OldStreamId="BJktkOEEX", myReceiver="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", RestApi="http://speckle.arup.digital/api/v1", Email="giovanni.brogiolo@arup.com", Server="undefined", StreamId="BJktkOEEX", Transmitting=false, Paused=false, StreamTextBoxEnabled=false)
code_block_2 = CodeBlock { "{"; }
code_block_3 = CodeBlock { ""; }
replace = String.Replace(str=anonymous_stream, searchFor=code_block_2, replaceWith=code_block_3)
code_block_4 = CodeBlock { "}"; }
replace_2 = String.Replace(str=replace, searchFor=code_block_4, replaceWith=code_block_3)
code_block_5 = CodeBlock { ", "; }
split = String.Split(str=replace_2, separater0=code_block_5)
toNumber = String.ToNumber(str=split)
python_script = Python(IN[0]=toNumber)
# ---------- python_script.python (23 lines) ----------
import clr

clr.AddReference('ProtoGeometry')
from Autodesk.DesignScript.Geometry import Point as Pt


#Preparing input from dynamo to revit
element = UnwrapElement(IN[0])
pts = []

for e in element:
	subList = []
	pts.append(subList)
	for item in e:
		subList.append(Pt.ByCoordinates
		(
		int(item[0]),
		int(item[1]),
		int(item[2])
		)
			)

OUT = pts
# ----------------------------------------
code_block_6 = CodeBlock { 3; }
byControlPoints = NurbsCurve.ByControlPoints(points=python_script, degree=code_block_6, lacing=Longest)
removeNulls = Lists.Manage.RemoveNulls()  # unwired: Data
byPoint = FamilyInstance.ByPoint()  # unwired: familyType, point
byPoints = NurbsCurve.ByPoints(points=python_script, degree=code_block_6)
byCurve = ModelCurve.ByCurve(curve=byPoints)
curves = Element.Curves(element=byCurve)
flatten = List.Flatten(list=curves)
levels = Levels(index=0)
structural_framing_types = StructuralFramingTypes(index=0)
beamByCurve = StructuralFraming.BeamByCurve(curve=flatten, level=levels, structuralFramingType=structural_framing_types)
code_block_7 = CodeBlock { a[0..10]; }  # unwired: a
select_model_elements = DSModelElementsSelection()  # 21 picked in the model
count = List.Count(list=python_script, lacing=Longest)
code_block_8 = CodeBlock(a=count) { a==6; }
filterByBoolMask = List.FilterByBoolMask(list=python_script, mask=code_block_8)
family_types = FamilyTypes(index=1)
byPoints_2 = AdaptiveComponent.ByPoints(points=filterByBoolMask.in, familyType=family_types)
code_block_9 = CodeBlock(a=python_script) { [a[0]]; }
