# Dynamo graph textNotes.dyn (Dynamo 2.0.1.4955)

select_model_element = DSModelElementSelection()  # 1 picked in the model
code_block = CodeBlock { "Type"; }
getParameterValueByName = Element.GetParameterValueByName(element=select_model_element, parameterName=code_block)
code_block_2 = CodeBlock { "Text Font"; }
code_block_3 = CodeBlock { "Arial"; }
setParameterByName = Element.SetParameterByName(element=getParameterValueByName, parameterName=code_block_2, value=code_block_3)
parameters = Element.Parameters(element=getParameterValueByName)
categories = Categories(index=571)
all_elements_of_category = ElementsOfCategory(Category=categories)
python_script = Python()  # unwired: IN[0]
# ---------- python_script.python (38 lines) ----------
import clr

clr.AddReference('RevitAPI')
from Autodesk.Revit.DB import *
from Autodesk.Revit.DB.Structure import *

clr.AddReference('RevitAPIUI')
from Autodesk.Revit.UI import *

clr.AddReference('System')
from System.Collections.Generic import List

clr.AddReference('RevitNodes')
import Revit
clr.ImportExtensions(Revit.GeometryConversion)
clr.ImportExtensions(Revit.Elements)

clr.AddReference('RevitServices')
import RevitServices
from RevitServices.Persistence import DocumentManager
from RevitServices.Transactions import TransactionManager

doc = DocumentManager.Instance.CurrentDBDocument
uidoc=DocumentManager.Instance.CurrentUIApplication.ActiveUIDocument

#Preparing input from dynamo to revit
textType = FilteredElementCollector( doc ).OfClass(TextNoteType)

#Do some action in a Transaction
TransactionManager.Instance.EnsureInTransaction(doc)

TransactionManager.Instance.TransactionTaskDone()

ele = [t for t in textType]

ele[2].Name = 'test2'

OUT = ele[0].CanBeRenamed, dir(ele[0]), ele
# ----------------------------------------
code_block_4 = CodeBlock(a=python_script) { a[2]; }
name = Element.Name(element=code_block_4)
