# Dynamo graph trainingClass.dyn (Dynamo 1.3.2.2480)

select_model_elements = DSModelElementsSelection()
getHost = FamilyInstance.GetHost()  # unwired: arg0
groupByFunction = GroupByFunction(select_model_elements, getHost)
getHost_2 = FamilyInstance.GetHost(select_model_elements)
uniqueItems = List.UniqueItems(getHost_2)
allIndicesOf = List.AllIndicesOf(list=getHost_2, item=uniqueItems)
getItemAtIndex = List.GetItemAtIndex(list=select_model_elements, index=allIndicesOf)
python_script = Python(IN[0]=getHost_2)
# ---------- python_script.python (117 lines) ----------
import clr
clr.AddReference("ProtoGeometry")
from Autodesk.DesignScript.Geometry import *

LineBestFit = Line.ByBestFitThroughPoints

# Import RevitAPI
clr.AddReference("RevitAPI")
from Autodesk.Revit.DB import *
clr.AddReference("RevitAPIUI")
from Autodesk.Revit.UI import TaskDialog
# Import DocumentManager and TransactionManager
clr.AddReference("RevitServices")
from RevitServices.Persistence import DocumentManager
from RevitServices.Transactions import TransactionManager
# Import ToProtoType, ToRevitType geometry conversion extension methods
clr.AddReference("RevitNodes")
import Revit
clr.ImportExtensions(Revit.GeometryConversion)

import math

doc = DocumentManager.Instance.CurrentDBDocument
uiapp = DocumentManager.Instance.CurrentUIApplication
app = uiapp.Application


openings = UnwrapElement(IN[0])




def checkParameter(param):
	for p in param:
		internal = p.Definition
		if internal.BuiltInParameter != BuiltInParameter.INVALID:
			return p
	return param[0]
	



def GetElemType(e):
	try:
		elemType = doc.GetElement(e.GetTypeId())
		return elemType
	except:
		pass
		return None

def GetParamValue(eType, pName):
	paramValue = None
	for i in eType.Parameters:
		if i.Definition.Name == pName:
			paramValue = i.AsValueString()
			#paramValue = i.AsDouble()
			break
		else:
			continue
	return paramValue


def GetParam(element, name):
	p = element.get_Parameter(element.GetParameters(name)[0])
	if p.StorageType == StorageType.String:
		return p.AsString()
	elif p.StorageType == StorageType.ElementId:
		elem = doc.GetElement(p.AsElementId())
		return elem
	elif p.StorageType == StorageType.Double:
		ProjectUnits = p.DisplayUnitType
		newval = UnitUtils.ConvertFromInternalUnits(p.AsDouble(),ProjectUnits)
		return newval
	else:
		return p.AsInteger()

def GetEndPoints(beam):
	return [beam.Location.Curve.GetEndPoint(0).ToPoint(), beam.Location.Curve.GetEndPoint(1).ToPoint()]


def PointXYDistance(Pt0, Pt1):
	distance = math.pow((math.pow((Pt0.X-Pt1.X),2) + math.pow((Pt0.Y-Pt1.Y),2)),0.5)
	return round(distance,0)

def beamRealCurve(element):
	vertex = element.Geometry()[0].Vertices
	pGeom = []
	for v in vertex:
		pGeom.append(v.PointGeometry)
	crv = LineBestFit(pGeom)	
	return crv
	



def GetBuiltInParam(element, name):
	p = element.get_Parameter(name)	
	if p.StorageType == StorageType.String:
		return p.AsString()
	elif p.StorageType == StorageType.ElementId:
		elem = doc.GetElement(p.AsElementId())
		return elem
	elif p.StorageType == StorageType.Double:
		ProjectUnits = p.DisplayUnitType
		newval = UnitUtils.ConvertFromInternalUnits(p.AsDouble(),ProjectUnits)
		return newval
	else:
		return p.AsInteger()
		
		
zOffset = GetBuiltInParam(openings[0], BuiltInParameter.Z_OFFSET_VALUE)




OUT = zOffset
#OUT = [o.Host for o in openings]
# ----------------------------------------
code_block = CodeBlock { "Offset"; }
python_script_2 = Python(IN[0]=select_model_elements, IN[1]=code_block)
# ---------- python_script_2.python (53 lines) ----------
import clr
clr.AddReference('ProtoGeometry')
from Autodesk.DesignScript.Geometry import *
clr.AddReference('RevitAPI')
from Autodesk.Revit.DB import *

clr.AddReference("RevitServices")
import RevitServices
from RevitServices.Persistence import DocumentManager
doc = DocumentManager.Instance.CurrentDBDocument
#The inputs to this node will be stored as a list in the IN variables.
if isinstance(IN[0], list):
	element = UnwrapElement(IN[0])
else:
	element = [UnwrapElement(IN[0])]
name = IN[1]
listout = []

def checkParameter(param):
	for p in param:
		internal = p.Definition
		if internal.BuiltInParameter != BuiltInParameter.INVALID:
			return p
	return param[0]

param = element[0].GetParameters(name)

internal = param[0].Definition


"""

for e in element:
	param = e.GetParameters(name)
	if len(param) == 0:
		listout.append(None)
	else:
		p = checkParameter(param)
		if p.StorageType == StorageType.String:
			listout.append(p.AsString())
		elif p.StorageType == StorageType.ElementId:
			elem = doc.GetElement(p.AsElementId())
			listout.append(elem)
		elif p.StorageType == StorageType.Double:
			ProjectUnits = p.DisplayUnitType
			newval = UnitUtils.ConvertFromInternalUnits(p.AsDouble(),ProjectUnits)
			listout.append(newval)
		else:
			listout.append(p.AsInteger())
	"""

#Assign your output to the OUT variable.
OUT = param[0].StorageType, param[0].AsDouble() 
# ----------------------------------------
code_block_2 = CodeBlock { {6,5}; }
python_script_3 = Python(IN[0]=code_block_2)
# ---------- python_script_3.python (7 lines) ----------
if isinstance(IN[0]):
	element = UnwrapElement(IN[0])
else:
	element = [UnwrapElement(IN[0])]


OUT = element
# ----------------------------------------
python_script_4 = Python(IN[0]=select_model_elements)
# ---------- python_script_4.python (41 lines) ----------
import clr
clr.AddReference("ProtoGeometry")
from Autodesk.DesignScript.Geometry import *

LineBestFit = Line.ByBestFitThroughPoints

# Import RevitAPI
clr.AddReference("RevitAPI")
from Autodesk.Revit.DB import *
clr.AddReference("RevitAPIUI")
from Autodesk.Revit.UI import TaskDialog
# Import DocumentManager and TransactionManager
clr.AddReference("RevitServices")
from RevitServices.Persistence import DocumentManager
from RevitServices.Transactions import TransactionManager
# Import ToProtoType, ToRevitType geometry conversion extension methods
clr.AddReference("RevitNodes")
import Revit
clr.ImportExtensions(Revit.GeometryConversion)

import math

doc = DocumentManager.Instance.CurrentDBDocument
uiapp = DocumentManager.Instance.CurrentUIApplication
app = uiapp.Application


openings = UnwrapElement(IN[0])

result = []
"""
for i in range(0,len(openings)):
	opWidth = openings[i].get_Parameter(openings[i].GetParameters("x")[0])
	if p.StorageType == StorageType.Double:
		result.append(p.AsDouble)
"""


param = openings[0].GetParameters("Offset")[0]

OUT = param.StorageType, int(param.AsValueString()), param.AsDouble(), param
# ----------------------------------------
type = Object.Type(python_script_4)
code_block_3 = CodeBlock { 3099; }
byCoordinates = Point.ByCoordinates(x=code_block_3)
byPoint = ReferencePoint.ByPoint(byCoordinates)
code_block_4 = CodeBlock { 0..5000..#10; }
byCoordinates_2 = Point.ByCoordinates(x=code_block_4)
byPoint_2 = ReferencePoint.ByPoint(byCoordinates_2)
python_script_5 = Python(IN[0]=byPoint_2)
# ---------- python_script_5.python (30 lines) ----------
import clr
# Import RevitAPI
clr.AddReference("RevitAPI")
import Autodesk
from Autodesk.Revit.DB import ReferencePointArray
# Import DocumentManager and TransactionManager
clr.AddReference("RevitServices")
import RevitServices
from RevitServices.Persistence import DocumentManager
from RevitServices.Transactions import TransactionManager
# Import ToDSType(bool) extension method
clr.AddReference("RevitNodes")
import Revit
clr.ImportExtensions(Revit.Elements)
# Unwrap
startRefPt = UnwrapElement( IN[0] )
# Start Transaction
doc = DocumentManager.Instance.CurrentDBDocument
TransactionManager.Instance.EnsureInTransaction(doc)
# Make the CurveByPoints
arr = ReferencePointArray()

for p in startRefPt:
	arr.Add(p)

cbp = doc.NewCurveByPoints(arr)
# End Transaction
TransactionManager.Instance.TransactionTaskDone()
# Wrap
OUT = cbp.ToDSType(False)
# ----------------------------------------
