# Dynamo graph trussanalysis.dyn (Dynamo 2.0.1.5055)

# group: Select Diagonal brace profile
family_types = FamilyTypes(index=6)
all_elements_of_family_type = ElementsOfFamilyType(Family_Type=family_types)

string = StringInput("Start Level Offset")
getParameterValueByName = Element.GetParameterValueByName(element=all_elements_of_family_type, parameterName=string)

# group: Select Top Chord section profile
family_types_2 = FamilyTypes(index=7)

string_2 = StringInput("d")
getParameterValueByName_2 = Element.GetParameterValueByName(element=family_types_2, parameterName=string_2)
code_block = CodeBlock(d=getParameterValueByName_2) { d/2; }
sub = getParameterValueByName - code_block

# group: Select Vertical members
family_types_3 = FamilyTypes(index=9)

# group: Filter by level
all_elements_of_family_type_2 = ElementsOfFamilyType(Family_Type=family_types_3)
string_3 = StringInput("Reference Level")
getParameterValueByName_3 = Element.GetParameterValueByName(parameterName=string_3)  # unwired: element
groupByFunction = List.GroupByFunction(list=all_elements_of_family_type_2, func=getParameterValueByName_3)
string_4 = StringInput("1st Floor")
eq = string_3 == string_4
filterByBoolMask = List.FilterByBoolMask(list=groupByFunction, mask=eq)

# group: Columns Points
getLocation = Element.GetLocation(element=filterByBoolMask.out)

flatten = List.Flatten(list=getLocation)

# group: Select Bottom Chord Section profile
family_types_4 = FamilyTypes(index=8)

# group: Filter by level
all_elements_of_family_type_3 = ElementsOfFamilyType(Family_Type=family_types_4)
string_5 = StringInput("Reference Level")
getParameterValueByName_4 = Element.GetParameterValueByName(parameterName=string_5)  # unwired: element
groupByFunction_2 = List.GroupByFunction(list=all_elements_of_family_type_3, func=getParameterValueByName_4)
string_6 = StringInput("1st Floor")
eq_2 = string_5 == string_6
filterByBoolMask_2 = List.FilterByBoolMask(list=groupByFunction_2, mask=eq_2)

location = StructuralFraming.Location(structuralFraming=filterByBoolMask_2.out)
string_7 = StringInput("bf")
getParameterValueByName_5 = Element.GetParameterValueByName(element=family_types_4, parameterName=string_7)
code_block_2 = CodeBlock(bf=getParameterValueByName_5) { bf/2; }

# group: Bottom Chord Axis
offset = Curve.Offset(curve=location, distance=code_block_2)

ZAxis = Vector.ZAxis()
project = Point.Project(point=flatten, baseGeometry=offset, projectionDirection=ZAxis, lacing=Longest)

# group: Bottom Chord Points
flatten_2 = List.Flatten(list=project)

all_elements_of_family_type_4 = ElementsOfFamilyType(Family_Type=family_types_2)

# group: Top Chord
location_2 = StructuralFraming.Location(structuralFraming=all_elements_of_family_type_4)

code_block_3 = CodeBlock(d=getParameterValueByName_2) { -d/2; }
translate = Geometry.Translate(geometry=location_2, zTranslation=code_block_3)

# group: Option 1 - Project point to Top Chord and reacreate diagonals. Not applicable in this case!
project_2 = Point.Project(point=flatten_2, baseGeometry=translate, projectionDirection=ZAxis, lacing=Longest)
flatten_3 = List.Flatten(list=project_2)

getLocation_2 = Element.GetLocation(element=all_elements_of_family_type)
startPoint = Curve.StartPoint(curve=getLocation_2)
distanceTo = Geometry.DistanceTo(geometry=startPoint, other=flatten_3, lacing=CrossProduct)
minimumItem = List.MinimumItem(list=distanceTo)
allIndicesOf = List.AllIndicesOf(list=distanceTo, item=minimumItem, lacing=Longest)
getItemAtIndex = List.GetItemAtIndex(list=flatten_3, index=allIndicesOf)
endPoint = Curve.EndPoint(curve=getLocation_2)

# group: Dovrebbe fare la stessa cosa ma non lo so usare!
distanceTo_2 = Geometry.DistanceTo(geometry=endPoint, other=flatten_2, lacing=CrossProduct)
minimumItem_2 = List.MinimumItem(list=distanceTo_2)
allIndicesOf_2 = List.AllIndicesOf(list=distanceTo_2, item=minimumItem_2, lacing=Longest)
closestPointTo = Geometry.ClosestPointTo(lacing=CrossProduct)  # unwired: geometry, other

# group: New bottom point
getItemAtIndex_2 = List.GetItemAtIndex(list=flatten_2, index=allIndicesOf_2)

byStartPointEndPoint = Line.ByStartPointEndPoint(startPoint=getItemAtIndex, endPoint=getItemAtIndex_2)
setLocation = Element.SetLocation(element=all_elements_of_family_type, geometry=byStartPointEndPoint)
