# Dynamo graph vectorUp.dyn (Dynamo 2.1.0.6255)

current = Document.Current()
activeView = Document.ActiveView(document=current)
select_model_elements = DSModelElementsSelection()  # 2 picked in the model
localCoordinateSystem = Custom[Element.LocalCoordinateSystem](element=select_model_elements)  # Get the insertion point and local axes of an element.
code_block = CodeBlock { 5000; }
scale = Vector.Scale(vector=localCoordinateSystem.Zvector, scale_factor=code_block)
byElementAndOffset = Tag.ByElementAndOffset(view=activeView, element=select_model_elements, offset=scale)
location = StructuralFraming.Location(structuralFraming=select_model_elements)
direction = Line.Direction(line=location)
python_script = Python()  # unwired: IN[0]
# ---------- python_script.python (34 lines) ----------
import clr

clr.AddReference('RevitAPI')
from Autodesk.Revit.DB import *
from Autodesk.Revit.DB.Structure import *

clr.AddReference('RevitAPIUI')
from Autodesk.Revit.UI import *

clr.AddReference('System')
from System.Collections.Generic import List

clr.AddReference('RevitNodes')
import Revit
clr.ImportExtensions(Revit.GeometryConversion)
clr.ImportExtensions(Revit.Elements)

clr.AddReference('RevitServices')
import RevitServices
from RevitServices.Persistence import DocumentManager
from RevitServices.Transactions import TransactionManager

doc = DocumentManager.Instance.CurrentDBDocument
uidoc=DocumentManager.Instance.CurrentUIApplication.ActiveUIDocument

#Preparing input from dynamo to revit
element = UnwrapElement(IN[0])

#Do some action in a Transaction
TransactionManager.Instance.EnsureInTransaction(doc)

TransactionManager.Instance.TransactionTaskDone()

OUT = 0
# ----------------------------------------
code_block_2 = CodeBlock { 0.5; }
pointAtParameter = Curve.PointAtParameter(curve=location, param=code_block_2)
handOrientation = Custom[FamilyInstance.HandOrientation](familyInstance=select_model_elements)  # Gets the hand orientation of a hosted object (e.g. a window or a door)
ZAxis = Vector.ZAxis()
cross = Vector.Cross(vector=handOrientation, cross=ZAxis)
byStartPointDirectionLength = Line.ByStartPointDirectionLength(startPoint=pointAtParameter, direction=cross, length=code_block)
