# Dynamo graph voidByFace2.dyn (Dynamo 2.1.0.5696)

file_path = Filename("C:\Users\giovanni.brogiolo\Desktop\CQT Beam Schedule_NJS.xlsx")  # graph input
fromPath = FileObject(path=file_path)  # "File.FromPath"
code_block = CodeBlock { "Values"; }
code_block_2 = CodeBlock { 1; }
importExcel = Data.ImportExcel(file=fromPath, sheetName=code_block, readAsStrings=code_block_2)
transpose = List.Transpose(lists=importExcel)
code_block_3 = CodeBlock { 0; }
getItemAtIndex = List.GetItemAtIndex(list=importExcel, index=code_block_3, lacing=Longest)
categories = Categories(index=521)  # graph input
all_elements_of_category = ElementsOfCategory(Category=categories)
code_block_4 = CodeBlock { "Reference Level"; }
getParameterValueByName = Element.GetParameterValueByName(parameterName=code_block_4)  # unwired: element
groupByFunction = List.GroupByFunction(list=all_elements_of_category, func=getParameterValueByName)
code_block_5 = CodeBlock { "Reference Level"; }
getParameterValueByName_2 = Element.GetParameterValueByName(element=groupByFunction, parameterName=code_block_5)
code_block_6 = CodeBlock { 0; }
getItemAtIndex_2 = List.GetItemAtIndex(list=getParameterValueByName_2, index=code_block_6, lacing=Longest)
name = Element.Name(element=getItemAtIndex_2)

# group: Beam by Level
byKeysValues = DesignScript.Builtin.Dictionary.ByKeysValues(keys=name, values=groupByFunction)

code_block_7 = CodeBlock { "Level 47 - HR"; }
valueAtKey = DesignScript.Builtin.Dictionary.ValueAtKey(dictionary=byKeysValues, key=code_block_7)
code_block_8 = CodeBlock { 0..5; }
getItemAtIndex_3 = List.GetItemAtIndex(list=importExcel@L2, index=code_block_8@L2, lacing=Longest)
deconstruct = List.Deconstruct(list=getItemAtIndex_3, lacing=Longest)
deconstruct_2 = List.Deconstruct(list=deconstruct.rest, lacing=Longest)

# group: Beam Informations
byKeysValues_2 = DesignScript.Builtin.Dictionary.ByKeysValues(keys=deconstruct.first, values=deconstruct_2.rest)

code_block_9 = CodeBlock { "Mark"; }
getParameterValueByName_3 = Element.GetParameterValueByName(element=valueAtKey, parameterName=code_block_9)
valueAtKey_2 = DesignScript.Builtin.Dictionary.ValueAtKey(dictionary=byKeysValues_2, key=getParameterValueByName_3)

# group: is null?
python_script = Python(IN[0]=valueAtKey_2)
# ---------- python_script.python (12 lines) ----------
# Enable Python support and load DesignScript library
import clr
clr.AddReference('ProtoGeometry')
from Autodesk.DesignScript.Geometry import *

# The inputs to this node will be stored as a list in the IN variables.
dataEnteringNode = IN

# Place your code below this line

# Assign your output to the OUT variable.
OUT = [i == None for i in IN[0]]
# ----------------------------------------

filterByBoolMask = List.FilterByBoolMask(list=valueAtKey, mask=python_script)
code_block_10 = CodeBlock { ["Profile","Grade","Camber","Shear Stud arrangement"]; }
filterByBoolMask_2 = List.FilterByBoolMask(list=valueAtKey_2, mask=python_script)
setParameterByName = Element.SetParameterByName(element=filterByBoolMask.out, parameterName=code_block_10@L2, value=filterByBoolMask_2.out, lacing=Longest)
