# Dynamo graph wallToRhino01.dyn (Dynamo 1.3.1.1736)

file_path = Filename("..\Desktop\24.3dm")
boolean = BoolSelector(true)

# group: SELECT ANALYTICAL WALL SURFACES
categories = Categories("WallAnalytical")
all_elements_of_category = ElementsOfCategory(categories)
geometry = Element.Geometry(all_elements_of_category)
code_block = CodeBlock { 255; 0; }
create_RhinoColor = Interoperability.WriteRhino.CreateRhinoObjects.Create_RhinoColor(code_block.out1, code_block.out0, code_block.out1)
code_block_2 = CodeBlock { "Wall Outlines"; }
create_RhinoLayer = Interoperability.WriteRhino.CreateRhinoObjects.Create_RhinoLayer(code_block_2, create_RhinoColor)

deconstruct = List.Deconstruct(list=geometry, lacing=Longest)
group_curves = Custom[Group Curves](Curves=deconstruct.rest, lacing=Longest)  # This node will take any input of flat list of curves and group them into sublists containing "joinable" curves that is continous curves. They might form closed curves or open curves. Use PolyCurve.ByJoinedCurves to convert output groups of curves into single PolyCurves
byJoinedCurves = PolyCurve.ByJoinedCurves(group_curves)
flatten = Flatten(byJoinedCurves)
DS_CurvesToRhino = Interoperability.WriteRhino.CreateRhinoGeometry.DS_CurvesToRhino(flatten)
code_block_3 = CodeBlock(A=flatten) { 1..Count(A); }
string_from_object = FromObject(code_block_3)

# group (continued): SELECT ANALYTICAL WALL SURFACES
create_RhinoObject = Interoperability.WriteRhino.CreateRhinoObjects.Create_RhinoObject(DS_CurvesToRhino, string_from_object, create_RhinoColor, create_RhinoLayer)

code_block_4 = CodeBlock(a=create_RhinoObject) { Flatten(a); }
code_block_5 = CodeBlock { "millimeters"; }
save_Rhino3dmModel = Interoperability.WriteRhino.SaveRhino3dmModel.Save_Rhino3dmModel(file_path, boolean, code_block_4, code_block_5)
code_block_6 = CodeBlock(s=deconstruct.rest) { s[7]; }
