# Dynamo graph worksharing.dyn (Dynamo 2.0.1.4955)

select_model_element = DSModelElementSelection()  # 1 picked in the model
python_script = Python(IN[0]=select_model_element)
# ---------- python_script.python (41 lines) ----------
import clr

clr.AddReference('RevitAPI')
from Autodesk.Revit.DB import *
from Autodesk.Revit.DB.Structure import *
from Autodesk.Revit.DB import WorksharingUtils

clr.AddReference('RevitAPIUI')
from Autodesk.Revit.UI import *

clr.AddReference('System')
from System.Collections.Generic import List

clr.AddReference('RevitNodes')
import Revit
clr.ImportExtensions(Revit.GeometryConversion)
clr.ImportExtensions(Revit.Elements)

clr.AddReference('RevitServices')
import RevitServices
from RevitServices.Persistence import DocumentManager
from RevitServices.Transactions import TransactionManager



doc = DocumentManager.Instance.CurrentDBDocument
uidoc=DocumentManager.Instance.CurrentUIApplication.ActiveUIDocument

eid = List[ElementId]()

#Preparing input from dynamo to revit
element = UnwrapElement(IN[0])

eid.Add(element.Id)

#ws = WorksharingUtils.CheckoutElements(doc, eid)
gs = WorksharingUtils.GetCheckoutStatus(doc, element.Id)
gh = WorksharingUtils.GetModelUpdatesStatus(doc, element.Id)
owner = WorksharingUtils.GetWorksharingTooltipInfo(doc, element.Id)

OUT = ws, gs, gh, owner.Creator
# ----------------------------------------
