# Dynamo graph 2.dyn (Dynamo 1.3.1.1736)

number_slider = DoubleSlider(12, range=0..100 step 1)
code_block = CodeBlock { 10; }
code_block_2 = CodeBlock { -50..50..#10; }
code_block_3 = CodeBlock { -50..50..#10; }
code_block_4 = CodeBlock(R=code_block, fi=code_block_2, teta=code_block_3) { x=R*Math.Cos(fi)*Math.Sin(teta); y=R*Math.Sin(fi)*Math.Sin(teta); z=R*Math.Cos(teta); }
code_block_5 = CodeBlock { u=0..360..#50; v=0..180..#50; }
sin = Math.Sin(code_block_5.u)
sin_2 = Math.Sin(code_block_5.v)
mul = sin * sin_2
cos = Math.Cos(code_block_5.u)
mul_2 = sin * cos
code_block_6 = CodeBlock { z=(x*x/a*a)-(y*y/b*b); }  # unwired: x, a, y, b
code_block_7 = CodeBlock { 10; }
code_block_8 = CodeBlock { 0..360..#50; }
code_block_9 = CodeBlock(R=code_block_7, u=code_block_8) { x = R*Math.Cos(u); y = R*Math.Sin(u); z = R*Math.Sin(u); }
code_block_10 = CodeBlock { 2; }
code_block_11 = CodeBlock { a; }  # unwired: a
code_block_12 = CodeBlock { 0..180..#50; }
code_block_13 = CodeBlock { 0..360..#50; }
code_block_14 = CodeBlock { 10; }
bySphericalCoordinates = Point.BySphericalCoordinates(arg1=code_block_12, arg2=code_block_13, arg3=code_block_14, lacing=CrossProduct)
code_block_15 = CodeBlock(R=code_block) { R*cosFi*sinTeta; R*sinFi*sinTeta; R*cosTeta; }  # unwired: cosFi, sinTeta, sinFi, cosTeta
code_block_16 = CodeBlock { 10; }
code_block_17 = CodeBlock { 0..360..#10; }
code_block_18 = CodeBlock(R=code_block_16, teta=code_block_17) { x=R*Math.Cos(teta); y=R*Math.Sin(teta); }
code_block_19 = CodeBlock { 0..90..#50; }
code_block_20 = CodeBlock { 0..180..#50; }
code_block_21 = CodeBlock { 10; }
python_script = Python(IN[0]=code_block_19, IN[1]=code_block_20, IN[2]=code_block_21)
# ---------- python_script.python (27 lines) ----------
import clr
import math
clr.AddReference('ProtoGeometry')
from Autodesk.DesignScript.Geometry import *
#The inputs to this node will be stored as a list in the IN variables.
fi = IN[0]
teta = IN[1]
R = IN[2]

x = []
y = []
z = []

for i in range(0,len(teta)):
	xx= []
	yy= []
	zz= []
	x.append(xx)
	y.append(yy)
	z.append(zz)
	for j in range(0,len(fi)):
		xx.append(R*math.cos(fi[j])*math.sin(teta[i]))
		yy.append(R*math.sin(fi[j])*math.sin(teta[i]))
		zz.append(R*math.cos(teta[i]))

#Assign your output to the OUT variable.
OUT = x,y,z
# ----------------------------------------
code_block_22 = CodeBlock(x=code_block_2, y=code_block_3, z=code_block_2) { Math.Pow(x,2)+Math.Pow(y,2)+Math.Pow(z,2); }
code_block_23 = CodeBlock { 4; }
code_block_24 = CodeBlock { x+y; }  # unwired: x, y
code_block_25 = CodeBlock { 5; }
code_block_26 = CodeBlock { 6; }
apply = ApplyFunction(code_block_24, code_block_25, code_block_26)  # "Function.Apply"
code_block_27 = CodeBlock()
# ---------- code_block_27.designscript (10 lines) ----------
def sphere(fi:int[],teta:int[],R)
{

x = R*Math.Cos(fi)*Math.Sin(teta);
y = R*Math.Sin(fi)*Math.Sin(teta);
z = R*Math.Cos(teta);

return = {x,y,z};

};
# ----------------------------------------
code_block_28 = CodeBlock { sphere(0..180..#10,0..360..#10,10); }
code_block_29 = CodeBlock()
# ---------- code_block_29.designscript (8 lines) ----------
def circle(teta:int[],R:int[])
{

x=R*Math.Cos(teta);
y=R*Math.Sin(teta);
return = {x,y};

};
# ----------------------------------------
python_script_2 = Python(IN[0]=code_block_19, IN[1]=code_block_20, IN[2]=code_block_21)
# ---------- python_script_2.python (29 lines) ----------
import clr
import math
clr.AddReference('ProtoGeometry')
from Autodesk.DesignScript.Geometry import *
#The inputs to this node will be stored as a list in the IN variables.
fi = IN[0]
teta = IN[1]
R = IN[2]

x = []
y = []
z = []

for t in teta:
	for f in fi:
		xx = R*(math.cos(f))*(math.sin(t))
		yy = R*(math.sin(f))*(math.sin(t))
		z.append(R*(math.cos(t)))
		"""
		x.append(xx)
		y.append(yy)
	"""
	if xx>fi[0] and xx<fi[len(fi)-1]:
			x.append(xx)
	if yy>teta[0] and yy<teta[len(fi)-1]:
			y.append(yy)

#Assign your output to the OUT variable.
OUT = x,y,z
# ----------------------------------------
code_block_30 = CodeBlock(a=python_script_2) { a[0]; a[1]; a[2]; }
byCoordinates = Point.ByCoordinates(x=code_block_30.out0, y=code_block_30.out1, z=code_block_30.out2)
code_block_31 = CodeBlock { 0..360..#10; }
code_block_32 = CodeBlock(code_block_31) { circle(a<1L>,10); }
deconstruct = List.Deconstruct(list=code_block_32, lacing=Longest)
python_script_3 = Python(IN[0]=code_block_19, IN[1]=code_block_20, IN[2]=code_block_21)
# ---------- python_script_3.python (12 lines) ----------
import clr
import math
clr.AddReference('ProtoGeometry')
from Autodesk.DesignScript.Geometry import *
#The inputs to this node will be stored as a list in the IN variables.
fi = IN[0]
teta = IN[1]
R = IN[2]


#Assign your output to the OUT variable.
OUT = fi[0], fi[len(fi)-1]
# ----------------------------------------
python_script_4 = Python(IN[0]=code_block_19, IN[1]=code_block_20, IN[2]=code_block_21)
# ---------- python_script_4.python (25 lines) ----------
import clr
import math
clr.AddReference('ProtoGeometry')
from Autodesk.DesignScript.Geometry import *
#The inputs to this node will be stored as a list in the IN variables.
fi = IN[0]
teta = IN[1]
R = IN[2]

x = []
y = []
z = []

for t in teta:
	for f in fi:
		xx = R*(math.cos(f))*(math.sin(t))
		yy = R*(math.sin(f))*(math.sin(t))
		z.append(R*(math.cos(t)))
		if xx>fi[0] and xx<fi[len(fi)-1]:
			x.append(xx)
		if yy>teta[0] and yy<teta[len(fi)-1]:
			y.append(yy)

#Assign your output to the OUT variable.
OUT = x,y,z
# ----------------------------------------
code_block_33 = CodeBlock()
# ---------- code_block_33.designscript (11 lines) ----------
def sample(npoints:int[],R)
{
teta = 2*Math.PI*Math.Random(npoints);
fi = Math.Acos(2*Math.Random(npoints)-1);

x = R*Math.Cos(fi)*Math.Sin(teta);
y = R*Math.Sin(fi)*Math.Sin(teta);
z = R*Math.Cos(teta);
return = {x,y,z};

};
# ----------------------------------------
code_block_34 = CodeBlock { Math.PI; Math.Random; }
code_block_35 = CodeBlock { 1..100; }
code_block_36 = CodeBlock(a=code_block_35) { sample(a,100); }
python_script_5 = Python(IN[0]=code_block_19, IN[1]=code_block_20, IN[2]=code_block_21)  # same code as python_script_4
code_block_37 = CodeBlock { -90..90..#50; }
code_block_38 = CodeBlock { 0..360..#50; }
code_block_39 = CodeBlock(a=code_block_35, theta=code_block_37, phi=code_block_38) { sample_trig(a,theta,phi); }
code_block_40 = CodeBlock(a=code_block_39) { a[0]; a[1]; a[2]; }
flatten = Flatten(code_block_40.out0)
flatten_2 = Flatten(code_block_40.out1)
flatten_3 = Flatten(code_block_40.out2)
byCoordinates_2 = Point.ByCoordinates(x=flatten, y=flatten_2, z=flatten_3, lacing=Longest)
code_block_41 = CodeBlock()
# ---------- code_block_41.designscript (9 lines) ----------
def sample_trig(npoints:int[],theta:int[],phi:int[])
{

    x = Math.Cos(theta) * Math.Cos(phi);
    y = Math.Cos(theta) * Math.Sin(phi);
    z = Math.Sin(theta);
    return = {x,y,z};

};
# ----------------------------------------
code_block_42 = CodeBlock()
# ---------- code_block_42.designscript (13 lines) ----------
def sample_trig_loop(npoints)
{
    x = Math.RandomList(npoints)*0
    y = Math.RandomList(npoints)*0
    z = Math.RandomList(npoints)*0
    for k in xrange(npoints):
        theta = 2*np.pi*np.random.rand()
        phi = np.arccos(2*np.random.rand()-1)
        x[k] = np.cos(theta) * np.sin(phi)
        y[k] = np.sin(theta) * np.sin(phi)
        z[k] = np.cos(phi)
    return np.array([x,y,z]);
};
# ----------------------------------------
code_block_43 = CodeBlock { 100; }
code_block_44 = CodeBlock(npoints=code_block_43) { Math.RandomList(npoints)*0; }
code_block_45 = CodeBlock { 100; }
code_block_46 = CodeBlock(npoints=code_block_45) { theta = 0*Math.PI*Math.Random(npoints)..2*Math.PI*Math.Random(npoints); phi = Math.Acos(2*Math.Random(npoints)-1); }
code_block_47 = CodeBlock { 50; }

# group: teta
code_block_48 = CodeBlock(n=code_block_47) { 0..1..#n; 0; 360; }

remapRange = Math.RemapRange(numbers=code_block_48.out0, newMin=code_block_48.out1, newMax=code_block_48.out2)

# group: fi
code_block_49 = CodeBlock(n=code_block_47) { 0..1..#n; 0; 180; }

remapRange_2 = Math.RemapRange(numbers=code_block_49.out0, newMin=code_block_49.out1, newMax=code_block_49.out2)
code_block_50 = CodeBlock(n=code_block_47) { -90..90..#n; }
cos_2 = Math.Cos(code_block_50)
code_block_51 = CodeBlock(n=code_block_47) { 0..360..#n; }
cos_3 = Math.Cos(code_block_51)
code_block_52 = CodeBlock(a=cos_2, b=cos_3) { x = a*b; }
cos_4 = Math.Cos(code_block_50)
sin_3 = Math.Sin(code_block_51)
code_block_53 = CodeBlock(a=cos_4, b=sin_3) { y = a*b; }
sin_4 = Math.Sin(code_block_50)
code_block_54 = CodeBlock(z=sin_4) { z; }
byCoordinates_3 = Point.ByCoordinates(x=code_block_52, y=code_block_53, z=code_block_54, lacing=CrossProduct)
code_block_55 = CodeBlock { 0.5; }
code_block_56 = CodeBlock { 0..2*Math.PI..#10; }
code_block_57 = CodeBlock { -1..1..#10; }
formula = Formula("1+v/2*cos(1/(2*u))*cos(u)", v=code_block_56, u=code_block_57)
formula_2 = Formula("1+v/2*cos(1/(2*u))*sin(u)", v=code_block_56, u=code_block_57)
formula_3 = Formula("v/2*sin(u/2)", v=code_block_56, u=code_block_57)
byCoordinates_4 = Point.ByCoordinates(x=formula, y=formula_2, z=formula_3)
teta = CodeBlock { -90..90..#10; }
phi = CodeBlock { 0..360..#10; }
formula_4 = Formula("cos(teta)*cos(phi)", teta=teta, phi=phi, lacing=CrossProduct)
formula_5 = Formula("cos(teta)*sin(phi)", teta=teta, phi=phi, lacing=CrossProduct)
formula_6 = Formula("sin(teta)", teta=teta, lacing=CrossProduct)
byCoordinates_5 = Point.ByCoordinates(x=formula_4, y=formula_5, z=formula_6)
