# Dynamo graph Cast in plate place holder.dyn (Dynamo 2.1.0.5696)

# group: Select All Beams
categories = Categories(index=521)  # graph input
all_elements_of_category = ElementsOfCategory(Category=categories)

select_model_elements = DSModelElementsSelection()  # 2 picked in the model

# group: Establish Where Cast-In Plates Required
code_block = CodeBlock { "Connection_End1_Type"; "Connection_End2_Type"; }
getParameterValueByName = Element.GetParameterValueByName(element=select_model_elements, parameterName=code_block.out1)
code_block_2 = CodeBlock(list=getParameterValueByName) { list; }
code_block_3 = CodeBlock(item=code_block_2) { DSCore.List.Flatten([item]); }
string_from_object = FromObject()  # unwired: obj
code_block_4 = CodeBlock { "CiP"; }
code_block_5 = CodeBlock(x=code_block_4) { x:string; }
boolean = BoolSelector(true)  # graph input
contains = String.Contains(searchFor=code_block_5, ignoreCase=boolean)  # unwired: str
compose = ComposeFunctions(func0=string_from_object, func1=contains)  # "Function.Compose"
map = List.Map(list=code_block_3, f_x=compose)
code_block_6 = CodeBlock(Bool=map) { Bool; }
filterByBoolMask = List.FilterByBoolMask(list=select_model_elements, mask=code_block_6)
getParameterValueByName_2 = Element.GetParameterValueByName(element=select_model_elements, parameterName=code_block.out0)
code_block_7 = CodeBlock(list=getParameterValueByName_2) { list; }
code_block_8 = CodeBlock(item=code_block_7) { DSCore.List.Flatten([item]); }
string_from_object_2 = FromObject()  # unwired: obj
code_block_9 = CodeBlock(x=code_block_4) { x:string; }
boolean_2 = BoolSelector(true)  # graph input
contains_2 = String.Contains(searchFor=code_block_9, ignoreCase=boolean_2)  # unwired: str
compose_2 = ComposeFunctions(func0=string_from_object_2, func1=contains_2)  # "Function.Compose"
map_2 = List.Map(list=code_block_8, f_x=compose_2)
code_block_10 = CodeBlock(Bool=map_2) { Bool; }
filterByBoolMask_2 = List.FilterByBoolMask(list=select_model_elements, mask=code_block_10)

# group: Coordinates of Cast-In Plates at End 2
python_script = Python(IN[0]=filterByBoolMask.in)
# ---------- python_script.python (94 lines) ----------
import clr
import math
clr.AddReference('RevitAPI')
from Autodesk.Revit.DB import *

clr.AddReference("RevitNodes")
import Revit
clr.ImportExtensions(Revit.GeometryConversion)

items = UnwrapElement(IN[0])
pointlist, curvepointlist, ispoint, iscurve, curves, haslocation, angles, hasrotation = [], [], [], [], [], [], [], []

for item in items:
	try:
		# points and text notes
		pointlist.append(item.Coord.ToPoint())
		ispoint.append(True)
		iscurve.append(False)
		haslocation.append(True)
		hasrotation.append(False)
	except:
		try:
			loc = item.Location
			if loc.ToString() == 'Autodesk.Revit.DB.LocationCurve':
				# line-based elements (e.g. walls)
				curvepoints = (loc.Curve.GetEndPoint(0).ToPoint(),loc.Curve.GetEndPoint(1).ToPoint())
				curvepointlist.append(curvepoints)
				curves.append(loc.Curve.ToProtoType())
				ispoint.append(False)
				iscurve.append(True)
				haslocation.append(True)
				hasrotation.append(False)
			elif loc.ToString() == 'Autodesk.Revit.DB.LocationPoint':
				# point-based elements
				pointlist.append(loc.Point.ToPoint())
				ispoint.append(True)
				iscurve.append(False)
				haslocation.append(True)
				try:
					angles.append(math.degrees(loc.Rotation))
					hasrotation.append(True)
				except:
					hasrotation.append(False)
			else:
				# check for host objects outlines (floor slabs etc.)
				try:
					refs = HostObjectUtils.GetTopFaces(item)
					blines = []
					bpoints = []
					for ref in refs:
						try:
							boundaries = item.GetGeometryObjectFromReference(ref).GetEdgesAsCurveLoops()
							for loop in boundaries:
								cloop = []
								clooppoints = []
								for line in loop:
									cloop.append(line.ToProtoType())
									curvepoint = (line.GetEndPoint(0).ToPoint(),line.GetEndPoint(1).ToPoint())
									clooppoints.append(curvepoint)
								blines.append(cloop)
								bpoints.append(clooppoints)
						except:
							pass
					if (len(blines) > 0):
						curves.append(blines)
						curvepointlist.append(bpoints)
						iscurve.append(True)
						haslocation.append(True)
					else:
						iscurve.append(False)
						haslocation.append(False)
					ispoint.append(False)
					hasrotation.append(False)
				except:
					ispoint.append(False)
					iscurve.append(False)
					haslocation.append(False)
					hasrotation.append(False)
		except:
			try:
				# curves
				curvepoints = (item.GetEndPoint(0).ToPoint(),item.GetEndPoint(1).ToPoint())
				curvepointlist.append(curvepoints)
				curves.append(item.ToProtoType())
				ispoint.append(False)
				iscurve.append(True)
				haslocation.append(True)
				hasrotation.append(False)
			except:
				ispoint.append(False)
				iscurve.append(False)
				haslocation.append(False)
				hasrotation.append(False)
OUT = (pointlist,curvepointlist,curves,ispoint,iscurve,haslocation,angles,hasrotation)
# ----------------------------------------
code_block_11 = CodeBlock(seq=python_script) { seq[0]; seq[1]; seq[2]; seq[3]; seq[4]; seq[5]; seq[6]; seq[7]; }
code_block_12 = CodeBlock(curveEndpoints=code_block_11.out1) { curveEndpoints; }
watch = Watch(code_block_12)

# group: Coordinates of Cast-In Plates at End 1
python_script_2 = Python(IN[0]=filterByBoolMask_2.in)  # same code as python_script
code_block_13 = CodeBlock(seq=python_script_2) { seq[0]; seq[1]; seq[2]; seq[3]; seq[4]; seq[5]; seq[6]; seq[7]; }
code_block_14 = CodeBlock(curveEndpoints=code_block_13.out1) { curveEndpoints; }
watch_2 = Watch(code_block_14)

# group: CiP Family Type
family_types = FamilyTypes(index=1091)  # graph input

startPoint = Curve.StartPoint(curve=code_block_13.out2)
endPoint = Curve.EndPoint(curve=code_block_11.out2)
create = List.Create(item0=startPoint, item1=endPoint)
flatten = List.Flatten(list=create)
byPoint = FamilyInstance.ByPoint(familyType=family_types, point=flatten)
code_block_15 = CodeBlock { 360; }
direction = Line.Direction(line=code_block_13.out2)
YAxis = Vector.YAxis()
angleWithVector = Vector.AngleWithVector(vector=direction, otherVector=YAxis)
sub = code_block_15 - angleWithVector
code_block_16 = CodeBlock { 180; }
direction_2 = Line.Direction(line=code_block_11.out2)
YAxis_2 = Vector.YAxis()
angleWithVector_2 = Vector.AngleWithVector(vector=direction_2, otherVector=YAxis_2)
sub_2 = code_block_16 - angleWithVector_2
create_2 = List.Create(item0=sub, item1=sub_2)
flatten_2 = List.Flatten(list=create_2)
setRotation = FamilyInstance.SetRotation(familyInstance=byPoint, degree=flatten_2)
parameters = Element.Parameters(element=select_model_elements)
