# Dynamo graph Cast in plate place holder01.dyn (Dynamo 2.1.0.5696)

select_model_element = DSModelElementSelection()  # 1 picked in the model
family_types = FamilyTypes(index=908)
select_face = DSFaceSelection()  # 1 picked in the model
all_elements_in_active_view = ElementsInView()
boolean = BoolSelector(true)
python_script = Python(IN[0]=boolean)
# ---------- python_script.python (41 lines) ----------
#Copyright(c) 2016, Dimitar Venkov
# @5devene, dimitar.ven@gmail.com

import clr

clr.AddReference("RevitAPIUI")
from  Autodesk.Revit.UI import *

clr.AddReference("RevitServices")
import RevitServices
from RevitServices.Persistence import DocumentManager
doc = DocumentManager.Instance.CurrentDBDocument
uidoc=DocumentManager.Instance.CurrentUIApplication.ActiveUIDocument

clr.AddReference("RevitNodes")
import Revit
clr.ImportExtensions(Revit.Elements)
clr.ImportExtensions(Revit.GeometryConversion)

clr.AddReference('RevitAPI')
from Autodesk.Revit.DB import *

def output1(x):
	if len(x) == 1: return x[0]
	else : return x

surfaces = []
sel1 = uidoc.Selection
ot1 = Selection.ObjectType.Face
ref_list = sel1.PickObjects(ot1, "Select the faces and press Finish.")
for ref in ref_list:
	el1 = doc.GetElement(ref.ElementId)
	sf0 = el1.GetGeometryObjectFromReference(ref)
	if isinstance(el1, FamilyInstance):
		tf1 = el1.GetTransform().ToCoordinateSystem()
		sf1 = sf0.Convert(ref, tf1)
	else:
		sf1 = sf0
	surfaces.append(sf1)

OUT = surfaces
# ----------------------------------------
python_script_2 = Python(IN[0]=all_elements_in_active_view, IN[1]=python_script, IN[2]=family_types)
# ---------- python_script_2.python (81 lines) ----------
import clr

clr.AddReference('RevitAPI')
from Autodesk.Revit.DB import *
from Autodesk.Revit.DB.Structure import *

clr.AddReference('RevitAPIUI')
from Autodesk.Revit.UI import *

clr.AddReference('System')
from System.Collections.Generic import List

clr.AddReference('RevitNodes')
import Revit
clr.ImportExtensions(Revit.GeometryConversion)
clr.ImportExtensions(Revit.Elements)

clr.AddReference('RevitServices')
import RevitServices
from RevitServices.Persistence import DocumentManager
from RevitServices.Transactions import TransactionManager

doc = DocumentManager.Instance.CurrentDBDocument
uidoc=DocumentManager.Instance.CurrentUIApplication.ActiveUIDocument


def BeamMidPoint(beam):
	#stPt = beam.Location.Curve.GetEndPoint(0)
	#endPt = beam.Location.Curve.GetEndPoint(0)
	return beam.Location.Curve.Evaluate(0.5,True)
	
def BeamDirection(beam):
	return beam.HandOrientation

def SignedDistanceTo(plane, p ):
	v = p - plane.Origin
	return plane.FaceNormal.DotProduct( v )
  
  
def ProjectOnto(plane, p):
	d = SignedDistanceTo(plane, p );
	q = p - d * plane.FaceNormal;
	return q;

def ProjectInto(plane, p ):
	q = ProjectOnto(plane, p);
	o = plane.Origin;
	d = q - o;
	u = d.DotProduct( plane.XVector );
	v = d.DotProduct( plane.YVector );
	return UV( u, v )
  

if isinstance(IN[0], list):
	elements = UnwrapElement(IN[0])
else:
	elements = [UnwrapElement(IN[0])]


wallFace = IN[1][0]
beams = []
points = []
fs = UnwrapElement(IN[2]) #VOID FAMILY TYPE

#TransactionManager.Instance.EnsureInTransaction(doc)

for e in elements:
	if e.Category.Name == "Structural Framing":
		check = BeamDirection(e).CrossProduct(wallFace.FaceNormal)
		upVector = XYZ(0,0,1)
		downVector = XYZ(0,0,-1)
		if not check.IsAlmostEqualTo(upVector) and not check.IsAlmostEqualTo(downVector):
			point = ProjectOnto(wallFace, BeamMidPoint(e))
			if wallFace.IsInside(ProjectInto(wallFace, point)):
				beams.append(e)
			#void = doc.Create.NewFamilyInstance.Overloads[Reference, XYZ, XYZ, FamilySymbol](wallFace.Reference, transformedPoint, direction, fs);

#TransactionManager.Instance.TransactionTaskDone()
p = [p.ToPoint() for p in points]

OUT = beams
# ----------------------------------------
XAxis = Vector.XAxis()
reverse = Vector.Reverse(vector=XAxis)
byFace = FamilyInstance.ByFace(familyType=family_types, face=select_face, location=python_script_2, referenceDirection=reverse)  # frozen
location = StructuralFraming.Location(structuralFraming=python_script_2)
code_block = CodeBlock { 0.5; }
pointAtParameter = Curve.PointAtParameter(curve=location, param=code_block)
direction = Line.Direction(line=location)
code_block_2 = CodeBlock { 1; }
current = Document.Current()
activeView = Document.ActiveView(document=current)
byOriginDirection = Revit.References.RayBounce.ByOriginDirection(origin=pointAtParameter, direction=direction, maxBounces=code_block_2, view=activeView)
code_block_3 = CodeBlock(a=byOriginDirection.points) { a; }
code_block_4 = CodeBlock(b=byOriginDirection.elements) { b; }
code_block_5 = CodeBlock { 1; }
selectInRevit = Custom[Springs.SelectInRevit](element=python_script_2, reset=code_block_5)  # Selects the input elements inside the Revit UI.
