# Dynamo graph Cast in plate place holder02.dyn (Dynamo 2.1.0.5696)

select_model_element = DSModelElementSelection()  # 1 picked in the model
family_types = FamilyTypes(index=908)
select_face = DSFaceSelection()  # 1 picked in the model
select_model_elements = DSModelElementsSelection()  # 12 picked in the model
boolean = BoolSelector(true)
python_script = Python(IN[0]=boolean)
# ---------- python_script.python (41 lines) ----------
#Copyright(c) 2016, Dimitar Venkov
# @5devene, dimitar.ven@gmail.com

import clr

clr.AddReference("RevitAPIUI")
from  Autodesk.Revit.UI import *

clr.AddReference("RevitServices")
import RevitServices
from RevitServices.Persistence import DocumentManager
doc = DocumentManager.Instance.CurrentDBDocument
uidoc=DocumentManager.Instance.CurrentUIApplication.ActiveUIDocument

clr.AddReference("RevitNodes")
import Revit
clr.ImportExtensions(Revit.Elements)
clr.ImportExtensions(Revit.GeometryConversion)

clr.AddReference('RevitAPI')
from Autodesk.Revit.DB import *

def output1(x):
	if len(x) == 1: return x[0]
	else : return x

surfaces = []
sel1 = uidoc.Selection
ot1 = Selection.ObjectType.Face
ref_list = sel1.PickObjects(ot1, "Select the faces and press Finish.")
for ref in ref_list:
	el1 = doc.GetElement(ref.ElementId)
	sf0 = el1.GetGeometryObjectFromReference(ref)
	if isinstance(el1, FamilyInstance):
		tf1 = el1.GetTransform().ToCoordinateSystem()
		sf1 = sf0.Convert(ref, tf1)
	else:
		sf1 = sf0
	surfaces.append(sf1)

OUT = surfaces
# ----------------------------------------

# group: get beams
python_script_2 = Python(IN[0]=select_model_elements, IN[1]=python_script, IN[2]=family_types)
# ---------- python_script_2.python (70 lines) ----------
import clr

clr.AddReference('RevitAPI')
from Autodesk.Revit.DB import *
from Autodesk.Revit.DB.Structure import *

clr.AddReference('RevitAPIUI')
from Autodesk.Revit.UI import *

clr.AddReference('System')
from System.Collections.Generic import List

clr.AddReference('RevitNodes')
import Revit
clr.ImportExtensions(Revit.GeometryConversion)
clr.ImportExtensions(Revit.Elements)

clr.AddReference('RevitServices')
import RevitServices
from RevitServices.Persistence import DocumentManager
from RevitServices.Transactions import TransactionManager

doc = DocumentManager.Instance.CurrentDBDocument
uidoc=DocumentManager.Instance.CurrentUIApplication.ActiveUIDocument


def BeamMidPoint(beam):
	return beam.Location.Curve.Evaluate(0.5,True)
	
def BeamDirection(beam):
	stPt = beam.Location.Curve.GetEndPoint(0)
	endPt = beam.Location.Curve.GetEndPoint(0)
	#return beam.HandOrientation
	return stPt-endPt

if isinstance(IN[0], list):
	elements = UnwrapElement(IN[0])
else:
	elements = [UnwrapElement(IN[0])]


wallFace = IN[1][0]
beams = []
points = []
fs = UnwrapElement(IN[2]) #VOID FAMILY TYPE

void = []
errors = []
TransactionManager.Instance.EnsureInTransaction(doc)

for e in elements:
	if e.Category.Name == "Structural Framing":
		beams.append(e)
		try:
			center = BeamMidPoint(e)
			rayDirection = BeamDirection(e)
			filter = ElementClassFilter(Wall);
			refIntersector = ReferenceIntersector(filter, FindReferenceTarget.Face, doc.ActiveView);
			referenceWithContext = refIntersector.FindNearest(center, rayDirection)
			reference = referenceWithContext.GetReference()
			intersection = reference.GlobalPoint
			#void.append(doc.Create.NewFamilyInstance.Overloads[Reference, XYZ, XYZ, FamilySymbol](reference, intersection, rayDirection, fs));
		except:
			errors.append("intersection not found")


TransactionManager.Instance.TransactionTaskDone()
#p = [p.ToPoint() for p in points]

OUT = beams, void, errors
# ----------------------------------------

XAxis = Vector.XAxis()
reverse = Vector.Reverse(vector=XAxis)
byFace = FamilyInstance.ByFace(familyType=family_types, face=select_face, location=python_script_2, referenceDirection=reverse)  # frozen
all_elements_in_active_view = ElementsInView()

# group: 01
python_script_3 = Python()  # frozen
# ---------- python_script_3.python (81 lines) ----------
import clr

clr.AddReference('RevitAPI')
from Autodesk.Revit.DB import *
from Autodesk.Revit.DB.Structure import *

clr.AddReference('RevitAPIUI')
from Autodesk.Revit.UI import *

clr.AddReference('System')
from System.Collections.Generic import List

clr.AddReference('RevitNodes')
import Revit
clr.ImportExtensions(Revit.GeometryConversion)
clr.ImportExtensions(Revit.Elements)

clr.AddReference('RevitServices')
import RevitServices
from RevitServices.Persistence import DocumentManager
from RevitServices.Transactions import TransactionManager

doc = DocumentManager.Instance.CurrentDBDocument
uidoc=DocumentManager.Instance.CurrentUIApplication.ActiveUIDocument


def BeamMidPoint(beam):
	#stPt = beam.Location.Curve.GetEndPoint(0)
	#endPt = beam.Location.Curve.GetEndPoint(0)
	return beam.Location.Curve.Evaluate(0.5,True)
	
def BeamDirection(beam):
	return beam.HandOrientation

def SignedDistanceTo(plane, p ):
	v = p - plane.Origin
	return plane.FaceNormal.DotProduct( v )
  
  
def ProjectOnto(plane, p):
	d = SignedDistanceTo(plane, p );
	q = p - d * plane.FaceNormal;
	return q;

def ProjectInto(plane, p ):
	q = ProjectOnto(plane, p);
	o = plane.Origin;
	d = q - o;
	u = d.DotProduct( plane.XVector );
	v = d.DotProduct( plane.YVector );
	return UV( u, v )
  

if isinstance(IN[0], list):
	elements = UnwrapElement(IN[0])
else:
	elements = [UnwrapElement(IN[0])]


wallFace = IN[1][0]
beams = []
points = []
fs = UnwrapElement(IN[2]) #VOID FAMILY TYPE

#TransactionManager.Instance.EnsureInTransaction(doc)

for e in elements:
	if e.Category.Name == "Structural Framing":
		check = BeamDirection(e).CrossProduct(wallFace.FaceNormal)
		upVector = XYZ(0,0,1)
		downVector = XYZ(0,0,-1)
		if not check.IsAlmostEqualTo(upVector) and not check.IsAlmostEqualTo(downVector):
			point = ProjectOnto(wallFace, BeamMidPoint(e))
			if wallFace.IsInside(ProjectInto(wallFace, point)):
				beams.append(e)
			#void = doc.Create.NewFamilyInstance.Overloads[Reference, XYZ, XYZ, FamilySymbol](wallFace.Reference, transformedPoint, direction, fs);

#TransactionManager.Instance.TransactionTaskDone()
p = [p.ToPoint() for p in points]

OUT = beams
# ----------------------------------------

# group: 02
python_script_4 = Python()  # frozen
# ---------- python_script_4.python (71 lines) ----------
import clr

clr.AddReference('RevitAPI')
from Autodesk.Revit.DB import *
from Autodesk.Revit.DB.Structure import *

clr.AddReference('RevitAPIUI')
from Autodesk.Revit.UI import *

clr.AddReference('System')
from System.Collections.Generic import List

clr.AddReference('RevitNodes')
import Revit
clr.ImportExtensions(Revit.GeometryConversion)
clr.ImportExtensions(Revit.Elements)

clr.AddReference('RevitServices')
import RevitServices
from RevitServices.Persistence import DocumentManager
from RevitServices.Transactions import TransactionManager

doc = DocumentManager.Instance.CurrentDBDocument
uidoc=DocumentManager.Instance.CurrentUIApplication.ActiveUIDocument


def BeamMidPoint(beam):
	#stPt = beam.Location.Curve.GetEndPoint(0)
	#endPt = beam.Location.Curve.GetEndPoint(0)
	return beam.Location.Curve.Evaluate(0.5,True)
	
def BeamDirection(beam):
	return beam.HandOrientation

if isinstance(IN[0], list):
	elements = UnwrapElement(IN[0])
else:
	elements = [UnwrapElement(IN[0])]


wallFace = IN[1][0]
beams = []
points = []
fs = UnwrapElement(IN[2]) #VOID FAMILY TYPE

void = []
errors = []
TransactionManager.Instance.EnsureInTransaction(doc)

for e in elements:
	if e.Category.Name == "Structural Framing":
		check = BeamDirection(e).CrossProduct(wallFace.FaceNormal)
		upVector = XYZ(0,0,1)
		downVector = XYZ(0,0,-1)
		if not check.IsAlmostEqualTo(upVector) and not check.IsAlmostEqualTo(downVector):
			#beams.append(e)
			try:
				center = BeamMidPoint(e)
				rayDirection = BeamDirection(e)
				filter = ElementClassFilter(Wall);
				refIntersector = ReferenceIntersector(filter, FindReferenceTarget.Face, doc.ActiveView);
				referenceWithContext = refIntersector.FindNearest(center, rayDirection)
				reference = referenceWithContext.GetReference()
				intersection = reference.GlobalPoint
				void.append(doc.Create.NewFamilyInstance.Overloads[Reference, XYZ, XYZ, FamilySymbol](reference, intersection, rayDirection, fs));
			except:
				errors.append("intersection not found")
TransactionManager.Instance.TransactionTaskDone()
#p = [p.ToPoint() for p in points]

OUT = void, errors
# ----------------------------------------

code_block = CodeBlock(a=python_script_2) { a[0]; }
location = StructuralFraming.Location(structuralFraming=code_block)
code_block_2 = CodeBlock { 0.5; }
pointAtParameter = Curve.PointAtParameter(curve=location, param=code_block_2)
direction = Line.Direction(line=location)
reverse_2 = Vector.Reverse(vector=direction)
code_block_3 = CodeBlock { 1; }
current = Document.Current()
activeView = Document.ActiveView(document=current)
byOriginDirection = Revit.References.RayBounce.ByOriginDirection(origin=pointAtParameter, direction=reverse_2, maxBounces=code_block_3, view=activeView)
code_block_4 = CodeBlock(b=byOriginDirection.elements) { DSCore.List.Flatten(b); }
python_script_5 = Python(IN[0]=code_block_4)
# ---------- python_script_5.python (72 lines) ----------
import clr

clr.AddReference('RevitAPI')
from Autodesk.Revit.DB import *
from Autodesk.Revit.DB.Structure import *

clr.AddReference('RevitAPIUI')
from Autodesk.Revit.UI import *

clr.AddReference('System')
from System.Collections.Generic import List

clr.AddReference('RevitNodes')
import Revit
clr.ImportExtensions(Revit.GeometryConversion)
clr.ImportExtensions(Revit.Elements)

clr.AddReference('RevitServices')
import RevitServices
from RevitServices.Persistence import DocumentManager
from RevitServices.Transactions import TransactionManager

doc = DocumentManager.Instance.CurrentDBDocument
uidoc=DocumentManager.Instance.CurrentUIApplication.ActiveUIDocument


def BeamMidPoint(beam):
	return beam.Location.Curve.Evaluate(0.5,True)
	
def BeamDirection(beam):
	stPt = beam.Location.Curve.GetEndPoint(0)
	endPt = beam.Location.Curve.GetEndPoint(0)
	#return beam.HandOrientation
	return stPt-endPt

 def GetWallFace(view, p)
    {
      filter = ElementClassFilter(Wall);

      ReferenceIntersector refIntersector 
        = new ReferenceIntersector( filter, 
          FindReferenceTarget.Face, view );

      refIntersector.FindReferencesInRevitLinks = true;

      ReferenceWithContext rwc = refIntersector.FindNearest( 
        p, XYZ.BasisZ );

      Reference r = (null == rwc) 
        ? null 
        : rwc.GetReference();

      if( null == r )
      {
        System.Windows.MessageBox.Show( "no intersecting geometry" );
      }
      return r;
}

walls = UnwrapElement(IN[0])

GeometryObject g = walls[0].GetGeometryObjectFromReference( r )


TransactionManager.Instance.EnsureInTransaction(doc)



TransactionManager.Instance.TransactionTaskDone()
#p = [p.ToPoint() for p in points]

OUT = beams, void, errors
# ----------------------------------------
code_block_5 = CodeBlock(a=byOriginDirection.points) { a; }
distanceTo = Geometry.DistanceTo(geometry=pointAtParameter, other=code_block_5@L2)
minimumItem = List.MinimumItem(list=distanceTo)
allIndicesOf = List.AllIndicesOf(list=distanceTo, item=minimumItem, lacing=Longest)
getItemAtIndex = List.GetItemAtIndex(list=code_block_5, index=allIndicesOf, lacing=Longest)
flatten = List.Flatten(list=getItemAtIndex)
byFace_2 = FamilyInstance.ByFace(familyType=family_types, face=code_block_4, location=flatten, referenceDirection=reverse)
select_model_elements_2 = DSModelElementsSelection()  # 3 picked in the model
python_script_6 = Python(IN[0]=select_model_elements_2)
# ---------- python_script_6.python (72 lines) ----------
import clr

clr.AddReference('RevitAPI')
from Autodesk.Revit.DB import *
from Autodesk.Revit.DB.Structure import *

clr.AddReference('RevitAPIUI')
from Autodesk.Revit.UI import *

clr.AddReference('System')
from System.Collections.Generic import List

clr.AddReference('RevitNodes')
import Revit
clr.ImportExtensions(Revit.GeometryConversion)
clr.ImportExtensions(Revit.Elements)

clr.AddReference('RevitServices')
import RevitServices
from RevitServices.Persistence import DocumentManager
from RevitServices.Transactions import TransactionManager

doc = DocumentManager.Instance.CurrentDBDocument
uidoc=DocumentManager.Instance.CurrentUIApplication.ActiveUIDocument


def BeamMidPoint(beam):
	return beam.Location.Curve.Evaluate(0.5,True)
	
def BeamDirection(beam):
	#stPt = beam.Location.Curve.GetEndPoint(0)
	#endPt = beam.Location.Curve.GetEndPoint(0)
	return beam.HandOrientation
	#return endPt-stPt

if isinstance(IN[0], list):
	elements = UnwrapElement(IN[0])
else:
	elements = [UnwrapElement(IN[0])]



beams = []
points = []


void = []
errors = []
references = []
TransactionManager.Instance.EnsureInTransaction(doc)

for e in elements:
	if e.Category.Name == "Structural Framing":
		beams.append(e)
		try:
			center = BeamMidPoint(e)
			rayDirection = BeamDirection(e)
			filter = ElementClassFilter(Wall);
			refIntersector = ReferenceIntersector(filter, FindReferenceTarget.Face, doc.ActiveView);
			referenceWithContext = refIntersector.FindNearest(center, rayDirection)
			reference = referenceWithContext.GetReference()
			references.append(reference)
			intersection = reference.GlobalPoint
			#void.append(doc.Create.NewFamilyInstance.Overloads[Reference, XYZ, XYZ, FamilySymbol](reference, intersection, rayDirection, fs));
		except:
			errors.append("intersection not found")


TransactionManager.Instance.TransactionTaskDone()
#p = [p.ToPoint() for p in points]

OUT = beams, void, errors, references, doc.ActiveView
# ----------------------------------------
