# Dynamo graph Cast in plate place holder03.dyn (Dynamo 2.1.0.5696)

select_model_elements = DSModelElementsSelection()  # 7 picked in the model
family_types = FamilyTypes(index=908)
python_script = Python(IN[0]=select_model_elements, IN[1]=family_types)
# ---------- python_script.python (104 lines) ----------
import clr

clr.AddReference('RevitAPI')
from Autodesk.Revit.DB import *
from Autodesk.Revit.DB.Structure import *

clr.AddReference('RevitAPIUI')
from Autodesk.Revit.UI import *

clr.AddReference('System')
from System.Collections.Generic import List

clr.AddReference('RevitNodes')
import Revit
clr.ImportExtensions(Revit.GeometryConversion)
clr.ImportExtensions(Revit.Elements)

clr.AddReference('RevitServices')
import RevitServices
from RevitServices.Persistence import DocumentManager
from RevitServices.Transactions import TransactionManager

doc = DocumentManager.Instance.CurrentDBDocument
uidoc=DocumentManager.Instance.CurrentUIApplication.ActiveUIDocument


def BeamMidPoint(beam):
	return beam.Location.Curve.Evaluate(0.5,True)

##DIFFERENT FROM BEAM HAND ORIENTATION!
def BeamEndDirection(beam):
	stPt = beam.Location.Curve.GetEndPoint(0)
	endPt = beam.Location.Curve.GetEndPoint(0)
	return stPt - endPt

def LocCurveDirection(beam):
	return beam.Location.Curve.Direction

def BeamDirection(beam):
	return beam.HandOrientation
	

def RaybounceFaceWalls(center, direction, view):
	try:
		filter = ElementClassFilter(Wall);
		refIntersector = ReferenceIntersector(filter, FindReferenceTarget.Face, view);
		referenceWithContext = refIntersector.FindNearest(center, direction)
		reference = referenceWithContext.GetReference()
		return [reference, reference.GlobalPoint]
	except:
		return "not found"



if isinstance(IN[0], list):
	elements = UnwrapElement(IN[0])
else:
	elements = [UnwrapElement(IN[0])]

fs = UnwrapElement(IN[1])

view = doc.ActiveView


beams = []
points = []


void = []
errors = []
references = []
cip = []

TransactionManager.Instance.EnsureInTransaction(doc)

for e in elements:
	if e.Category.Name == "Structural Framing":
		beams.append(e)
		center = BeamMidPoint(e)
		rayDirection = BeamDirection(e)
		rb = RaybounceFaceWalls(center, rayDirection, view)
		if rb != "not found":
			references.append(rb[0])
			points.append(rb[1])
			cip.append(doc.Create.NewFamilyInstance.Overloads[Reference, XYZ, XYZ, FamilySymbol](rb[0], rb[1], rayDirection.CrossProduct(XYZ(0,0,1)), fs));
			errors.append("beam direction")
		else:
			reverseDirection = -rayDirection
			rc = RaybounceFaceWalls(center, reverseDirection, view)
			if rc != "not found":
				references.append(rc[0])
				points.append(rc[1])
				cip.append(doc.Create.NewFamilyInstance.Overloads[Reference, XYZ, XYZ, FamilySymbol](rc[0], rc[1], reverseDirection.CrossProduct(XYZ(0,0,1)), fs));
				errors.append("reverse direction")
			else:
				errors.append("wall not found")

			

TransactionManager.Instance.TransactionTaskDone()
#p = [p.ToPoint() for p in points]


OUT = beams, errors, references, points, cip
# ----------------------------------------
