# Dynamo graph Cast in plate place holder04.dyn (Dynamo 2.1.0.5696)

select_model_elements = DSModelElementsSelection()  # 2 picked in the model
code_block = CodeBlock { "CasIntPlateFaceBasedBars"; }
byName = FamilyType.ByName(name=code_block)
refresh = BoolSelector(false)
python_script = Python(IN[0]=select_model_elements, IN[1]=byName, IN[2]=refresh)
# ---------- python_script.python (189 lines) ----------
import clr

clr.AddReference('RevitAPI')
from Autodesk.Revit.DB import *
from Autodesk.Revit.DB.Structure import *

clr.AddReference('RevitAPIUI')
from Autodesk.Revit.UI import *

clr.AddReference('System')
from System.Collections.Generic import List

clr.AddReference('RevitNodes')
import Revit
clr.ImportExtensions(Revit.GeometryConversion)
clr.ImportExtensions(Revit.Elements)

clr.AddReference('RevitServices')
import RevitServices
from RevitServices.Persistence import DocumentManager
from RevitServices.Transactions import TransactionManager

import math

doc = DocumentManager.Instance.CurrentDBDocument
uidoc=DocumentManager.Instance.CurrentUIApplication.ActiveUIDocument


def BeamMidPoint(beam):
	return beam.Location.Curve.Evaluate(0.5,True)

##DIFFERENT FROM BEAM HAND ORIENTATION!
def BeamEndDirection(beam):
	stPt = beam.Location.Curve.GetEndPoint(0)
	endPt = beam.Location.Curve.GetEndPoint(0)
	return stPt - endPt

def LocCurveDirection(beam):
	return beam.Location.Curve.Direction

def BeamDirection(beam):
	return beam.HandOrientation
	

def RaybounceFaceWalls(center, direction, view):
	try:
		filter = ElementClassFilter(Wall);
		refIntersector = ReferenceIntersector(filter, FindReferenceTarget.Face, view);
		referenceWithContext = refIntersector.FindNearest(center, direction)
		reference = referenceWithContext.GetReference()
		return [reference, reference.GlobalPoint]
	except:
		return "not found"

def GetBeamHeight(element, view):
	bb = element.get_BoundingBox(view)
	max = bb.Max.Z
	min = bb.Min.Z
	p = element.get_Parameter(BuiltInParameter.Z_OFFSET_VALUE)
	ProjectUnits = p.DisplayUnitType
	zOffset = UnitUtils.ConvertFromInternalUnits(p.AsDouble(),ProjectUnits)
	return math.ceil((max-min)*304.8) + zOffset

def GetBeamWidth(element, view):
	bb = element.get_BoundingBox(view)
	max = bb.Max.Y
	min = bb.Min.Y
	return math.ceil((max-min)*304.8)


def GetBeamWidthBBox(beam):
	opt = Options()
	opt.ComputeReferences = True
	opt.IncludeNonVisibleObjects = False
	opt.View = doc.ActiveView
	geomInst = None;
	instTransform = None;
	obj = beam.get_Geometry(opt)
	bb = obj.GetBoundingBox()
	type = []
	for instance in obj:
		try:
			type.append(instance.GetType())
			geomInst = instance.GetSymbolGeometry()
			instTransform = instance.Transform;
		except:
			continue
	geoBox = geomInst.GetBoundingBox()
	return int((geoBox.Max.Y - geoBox.Min.Y)*304.8)

def GetBeamZOffset(element):
	p = element.get_Parameter(BuiltInParameter.Z_OFFSET_VALUE)
	ProjectUnits = p.DisplayUnitType
	zOffset = UnitUtils.ConvertFromInternalUnits(p.AsDouble(),ProjectUnits)
	return -zOffset
	
def SetCipInstaParam(beam, cip):
	errors = []
	try:
		p = cip.LookupParameter("Plate Height")
		h = GetBeamHeight(beam,view)
		if h>310:
			p.Set(h/304.8)
		else:
			p.Set(300/304.8)
	except:
		errors.append("height failed")
	try:
		p = cip.LookupParameter("Plate Width")
		p.Set((GetBeamWidthBBox(beam)+100)/304.8)
	except:
		errors.append("width failed")
	try:
		p = cip.LookupParameter("Top Offset")
		p.Set(GetBeamZOffset(beam)/304.8)
	except:
		errors.append("zOffset failed")
	return errors


if isinstance(IN[0], list):
	elements = UnwrapElement(IN[0])
else:
	elements = [UnwrapElement(IN[0])]

fs = UnwrapElement(IN[1])

view = doc.ActiveView


beams = []
points = []


void = []
errors = []
references = []
cipList = []

TransactionManager.Instance.EnsureInTransaction(doc)

for e in elements:
	if e.Category.Name == "Structural Framing":
		try:
			beams.append(e)
			center = BeamMidPoint(e)
			rayDirection = BeamDirection(e)
			rb = RaybounceFaceWalls(center, rayDirection, view) #ray in beam direction
			reverseDirection = -rayDirection
			rc = RaybounceFaceWalls(center, reverseDirection, view) #ray in beam inverse direction
			if rb != "not found" and rc != "not found":
				references.append(rb[0])
				points.append(rb[1])
				references.append(rc[0])
				points.append(rc[1])
				cip1 = doc.Create.NewFamilyInstance.Overloads[Reference, XYZ, XYZ, FamilySymbol](rb[0], rb[1], rayDirection.CrossProduct(XYZ(0,0,1)), fs)
				errors.append(SetCipInstaParam(e, cip1))
				cipList.append(cip1)
				cip2 = doc.Create.NewFamilyInstance.Overloads[Reference, XYZ, XYZ, FamilySymbol](rc[0], rc[1], reverseDirection.CrossProduct(XYZ(0,0,1)), fs)
				errors.append(SetCipInstaParam(e, cip2))
				cipList.append(cip2)
				errors.append("beam start point")
				errors.append("beam end point")
			elif rc != "not found":
				references.append(rc[0])
				points.append(rc[1])
				cip = doc.Create.NewFamilyInstance.Overloads[Reference, XYZ, XYZ, FamilySymbol](rc[0], rc[1], reverseDirection.CrossProduct(XYZ(0,0,1)), fs)
				errors.append(SetCipInstaParam(e, cip))
				cipList.append(cip)
				errors.append("reverse direction")
			elif rb != "not found":
				references.append(rb[0])
				points.append(rb[1])
				references.append(rc[0])
				points.append(rc[1])
				cip = doc.Create.NewFamilyInstance.Overloads[Reference, XYZ, XYZ, FamilySymbol](rb[0], rb[1], rayDirection.CrossProduct(XYZ(0,0,1)), fs)
				errors.append(SetCipInstaParam(e, cip))
				cipList.append(cip)
			else:
				errors.append("wall not found")
		except:
			errors.append("Uh-oh something went wrong")
			

TransactionManager.Instance.TransactionTaskDone()
#p = [p.ToPoint() for p in points]


OUT = beams, errors, references, points, cipList
# ----------------------------------------
select_model_elements_2 = DSModelElementsSelection()  # 1 picked in the model
python_script_2 = Python(IN[0]=select_model_elements_2)  # unwired: IN[1]
# ---------- python_script_2.python (129 lines) ----------
import clr

clr.AddReference('RevitAPI')
from Autodesk.Revit.DB import *
from Autodesk.Revit.DB.Structure import *

clr.AddReference('RevitAPIUI')
from Autodesk.Revit.UI import *

clr.AddReference('System')
from System.Collections.Generic import List

clr.AddReference('RevitNodes')
import Revit
clr.ImportExtensions(Revit.GeometryConversion)
clr.ImportExtensions(Revit.Elements)

clr.AddReference('RevitServices')
import RevitServices
from RevitServices.Persistence import DocumentManager
from RevitServices.Transactions import TransactionManager

import math

doc = DocumentManager.Instance.CurrentDBDocument
uidoc=DocumentManager.Instance.CurrentUIApplication.ActiveUIDocument


def BeamMidPoint(beam):
	return beam.Location.Curve.Evaluate(0.5,True)

##DIFFERENT FROM BEAM HAND ORIENTATION!
def BeamEndDirection(beam):
	stPt = beam.Location.Curve.GetEndPoint(0)
	endPt = beam.Location.Curve.GetEndPoint(0)
	return stPt - endPt

def LocCurveDirection(beam):
	return beam.Location.Curve.Direction

def BeamDirection(beam):
	return beam.HandOrientation
	

def RaybounceFaceWalls(center, direction, view):
	try:
		filter = ElementClassFilter(Wall);
		refIntersector = ReferenceIntersector(filter, FindReferenceTarget.Face, view);
		referenceWithContext = refIntersector.FindNearest(center, direction)
		reference = referenceWithContext.GetReference()
		return [reference, reference.GlobalPoint]
	except:
		return "not found"


def GetBeamHeight(element, view):
	bb = element.get_BoundingBox(view)
	max = bb.Max.Z
	min = bb.Min.Z
	p = element.get_Parameter(BuiltInParameter.Z_OFFSET_VALUE)
	ProjectUnits = p.DisplayUnitType
	zOffset = UnitUtils.ConvertFromInternalUnits(p.AsDouble(),ProjectUnits)
	return math.ceil((max-min)*304.8) + zOffset
	

def GetBeamWidth(element, view):
	bb = element.get_BoundingBox(view)
	max = bb.Max.Y
	min = bb.Min.Y
	return math.ceil((max-min)*304.8)
	
def GetBeamZOffset(element):
	p = element.get_Parameter(BuiltInParameter.Z_OFFSET_VALUE)
	ProjectUnits = p.DisplayUnitType
	zOffset = UnitUtils.ConvertFromInternalUnits(p.AsDouble(),ProjectUnits)
	return -zOffset
	
beam = UnwrapElement(IN[0])
cip =  UnwrapElement(IN[1])
view = doc.ActiveView

def SetCipInstaParam(beam, cip):
	errors = []
	try:
		p = cip.LookupParameter("Plate Height")
		p.Set(GetBeamHeight(beam,view)/304.8)
	except:
		errors.append("height failed")
	try:
		p = cip.LookupParameter("Plate Width")
		p.Set((GetBeamWidth(beam,view)+100)/304.8)
	except:
		errors.append("width failed")
	try:
		p = cip.LookupParameter("Top Offset")
		p.Set(GetBeamZOffset(beam)/304.8)
	except:
		errors.append("zOffset failed")
	return errors
	
def GetBottomCorners(b, z ):
      return [( b.Min.X, b.Min.Y, z ), ( b.Max.X, b.Min.Y, z ), ( b.Max.X, b.Max.Y, z ), ( b.Min.X, b.Max.Y, z )]

def GetBottomCornersMinZ( b ):
      return GetBottomCorners( b, b.Min.Z )



def GetBeamWidth(beam):
	opt = Options()
	opt.ComputeReferences = True
	opt.IncludeNonVisibleObjects = False
	opt.View = doc.ActiveView
	geomInst = None;
	instTransform = None;
	obj = beam.get_Geometry(opt)
	bb = obj.GetBoundingBox()
	type = []
	for instance in obj:
		try:
			type.append(instance.GetType())
			geomInst = instance.GetSymbolGeometry()
			instTransform = instance.Transform;
		except:
			return "can't get the beam width"
	geoBox = geomInst.GetBoundingBox()
	return int((geoBox.Max.Y - geoBox.Min.Y)*304.8)

OUT =  GetBeamWidth(beam)
# ----------------------------------------
select_model_elements_3 = DSModelElementsSelection()  # 1 picked in the model
saveAs = Custom[Document.SaveAs]()  # Saves the active Revit document under the given name.; unwired: filePath
code_block_2 = CodeBlock {  }
