# Dynamo graph Cast in plate place holder05.dyn (Dynamo 2.0.1.5055)

select_model_elements = DSModelElementsSelection()  # 334 picked in the model
code_block = CodeBlock { "CasIntPlateFaceBasedBars"; }
byName = FamilyType.ByName(name=code_block)
file_path = Filename("\\global.arup.com\australasia\SYD\Projects\256000\256686-00 CQT Sydney\Work\Internal\Drawings\Struct\01_RVT\05_Dynamo Scripts\Detached Model\181120_CiP Sizes_GB.xlsx")
file_from_path = FileObject(path=file_path)
code_block_2 = CodeBlock { "TypicalFloors"; }
importExcel = Data.ImportExcel(file=file_from_path, sheetName=code_block_2)

# group: Offset above TOS
code_block_3 = CodeBlock { 10; }

# group: Ignore walls distant more than 2 feet from the beam end
code_block_4 = CodeBlock { 2; }

refresh = BoolSelector(true)

# group: Typical
python_script = Python(IN[0]=select_model_elements, IN[1]=byName, IN[2]=importExcel, IN[3]=code_block_3, IN[4]=code_block_4, IN[5]=refresh)  # frozen
# ---------- python_script.python (215 lines) ----------
import clr

clr.AddReference('RevitAPI')
from Autodesk.Revit.DB import *
from Autodesk.Revit.DB.Structure import *

clr.AddReference('RevitAPIUI')
from Autodesk.Revit.UI import *

clr.AddReference('System')
from System.Collections.Generic import List

clr.AddReference('RevitNodes')
import Revit
clr.ImportExtensions(Revit.GeometryConversion)
clr.ImportExtensions(Revit.Elements)

clr.AddReference('RevitServices')
import RevitServices
from RevitServices.Persistence import DocumentManager
from RevitServices.Transactions import TransactionManager

import math

doc = DocumentManager.Instance.CurrentDBDocument
uidoc=DocumentManager.Instance.CurrentUIApplication.ActiveUIDocument

### INPUTS###

if isinstance(IN[0], list):
	elements = UnwrapElement(IN[0])
else:
	elements = [UnwrapElement(IN[0])]

fs = UnwrapElement(IN[1])

excelData = IN[2]

plateOffset = IN[3]

###


class beamType:
	def __init__(self, beamType, CiPType, plateH, plateW):
		self.beamType = beamType
		self.CiPType = CiPType
		self.plateH = plateH
		self.plateW = plateW
	def printOut(self):
		return [self.beamType, self.CiPType, self.plateH, self.plateW]


#loop through the beam types instances and find the instance by its name
def returnCiPInstance(beam, beamTypes):
	for b in beamTypes:
		if b.beamType in beam.Name:
			return b
			
CiPs = []

for list in excelData:
	CiPs.append(beamType(list[0],list[1],list[2],list[3]))
	

def BeamLength(beam):
	return beam.Location.Curve.Length

def BeamMidPoint(beam):
	return beam.Location.Curve.Evaluate(0.5,True)

##DIFFERENT FROM BEAM HAND ORIENTATION!
def BeamEndDirection(beam):
	stPt = beam.Location.Curve.GetEndPoint(0)
	endPt = beam.Location.Curve.GetEndPoint(0)
	return stPt - endPt

def LocCurveDirection(beam):
	return beam.Location.Curve.Direction

def BeamDirection(beam):
	return beam.HandOrientation
	

def RaybounceFaceWalls(center, direction, view, beam):
	try:
		filter = ElementClassFilter(Wall);
		refIntersector = ReferenceIntersector(filter, FindReferenceTarget.Face, view);
		referenceWithContext = refIntersector.FindNearest(center, direction)
		reference = referenceWithContext.GetReference()
		if abs(center.DistanceTo(reference.GlobalPoint)) - BeamLength(beam)*0.5 < IN[4]: # in feet!!
			return [reference, reference.GlobalPoint]
		else:
			return "too far"
	except:
		return "not found"


def GetBeamZOffset(element):
	p = element.get_Parameter(BuiltInParameter.Z_OFFSET_VALUE)
	ProjectUnits = p.DisplayUnitType
	zOffset = UnitUtils.ConvertFromInternalUnits(p.AsDouble(),ProjectUnits)
	return -zOffset
	
	

def SetCipInstaParam(beam, cipInstance, CiPs, offset):
	cipType = returnCiPInstance(beam, CiPs)
	errors = []
	try:
		p = cipInstance.LookupParameter("Plate Height")
		p.Set(cipType.plateH/304.8)
	except:
		errors.append("height failed")
	try:
		p = cipInstance.LookupParameter("Plate Width")
		p.Set(cipType.plateW/304.8)
	except:
		errors.append("width failed")
	try:
		p = cipInstance.LookupParameter("Top Offset")
		p.Set((GetBeamZOffset(beam)-offset)/304.8)
	except:
		errors.append("zOffset failed")
	try:
		p = cipInstance.LookupParameter("Beam Level")
		workPlane = beam.LookupParameter("Work Plane").AsString()
		p.Set(workPlane)
	except:
		errors.append("Beam level failed")
	try:
		p = cipInstance.LookupParameter("Beam Type")
		p.Set(beam.Name)
	except:
		errors.append("Beam Type failed")
	try:
		p = cipInstance.LookupParameter("CiP Type")
		p.Set(cipType.CiPType)
	except:
		errors.append("CiP type failed")
	try:
		level = beam.LookupParameter("Reference Level").AsElementId()
		p = cipInstance.LookupParameter("Schedule Level")
		p.Set(level)
	except:
		errors.append("Schedule Level Failed")
	return errors






view = doc.ActiveView


beams = []
points = []


void = []
errors = []
references = []
cipList = []

TransactionManager.Instance.EnsureInTransaction(doc)

for e in elements:
	if e.Category.Name == "Structural Framing":
		try:
			beams.append(e)
			center = BeamMidPoint(e)
			rayDirection = BeamDirection(e)
			rb = RaybounceFaceWalls(center, rayDirection, view, e) #ray in beam direction from beam mid point
			reverseDirection = -rayDirection
			rc = RaybounceFaceWalls(center, reverseDirection, view, e) #ray in beam inverse direction from beam mid point
			if rb != "not found" and rc != "not found":
				references.append(rb[0])
				points.append(rb[1])
				references.append(rc[0])
				points.append(rc[1])
				cip1 = doc.Create.NewFamilyInstance.Overloads[Reference, XYZ, XYZ, FamilySymbol](rb[0], rb[1], rayDirection.CrossProduct(XYZ(0,0,1)), fs)
				errors.append(SetCipInstaParam(e, cip1, CiPs, plateOffset))	#SetCipInstaParam(beam, cipInstance, beamTypes, offset):
				cipList.append(cip1)
				cip2 = doc.Create.NewFamilyInstance.Overloads[Reference, XYZ, XYZ, FamilySymbol](rc[0], rc[1], reverseDirection.CrossProduct(XYZ(0,0,1)), fs)
				errors.append(SetCipInstaParam(e, cip2, CiPs, plateOffset))
				cipList.append(cip2)
				errors.append("beam start point")
				errors.append("beam end point")
			elif rc != "not found":
				references.append(rc[0])
				points.append(rc[1])
				cip = doc.Create.NewFamilyInstance.Overloads[Reference, XYZ, XYZ, FamilySymbol](rc[0], rc[1], reverseDirection.CrossProduct(XYZ(0,0,1)), fs)
				errors.append(SetCipInstaParam(e, cip, CiPs, plateOffset))
				cipList.append(cip)
				errors.append("reverse direction")
			elif rb != "not found":
				references.append(rb[0])
				points.append(rb[1])
				references.append(rc[0])
				points.append(rc[1])
				cip = doc.Create.NewFamilyInstance.Overloads[Reference, XYZ, XYZ, FamilySymbol](rb[0], rb[1], rayDirection.CrossProduct(XYZ(0,0,1)), fs)
				errors.append(SetCipInstaParam(e, cip, CiPs, plateOffset))
				cipList.append(cip)
			else:
				errors.append("wall not found")
		except:
			errors.append("Uh-oh something went wrong")
			

TransactionManager.Instance.TransactionTaskDone()
#p = [p.ToPoint() for p in points]


OUT = beams, errors, references, points, cipList
# ----------------------------------------

select_model_element = DSModelElementSelection()  # 1 picked in the model

# group: single beam
python_script_2 = Python(IN[0]=select_model_element, IN[1]=importExcel, IN[2]=byName)
# ---------- python_script_2.python (212 lines) ----------
import clr

clr.AddReference('RevitAPI')
from Autodesk.Revit.DB import *
from Autodesk.Revit.DB.Structure import *

clr.AddReference('RevitAPIUI')
from Autodesk.Revit.UI import *

clr.AddReference('System')
from System.Collections.Generic import List

clr.AddReference('RevitNodes')
import Revit
clr.ImportExtensions(Revit.GeometryConversion)
clr.ImportExtensions(Revit.Elements)

clr.AddReference('RevitServices')
import RevitServices
from RevitServices.Persistence import DocumentManager
from RevitServices.Transactions import TransactionManager

import math
from System.Collections.Generic import Dictionary,List

doc = DocumentManager.Instance.CurrentDBDocument
uidoc=DocumentManager.Instance.CurrentUIApplication.ActiveUIDocument


def BeamMidPoint(beam):
	return beam.Location.Curve.Evaluate(0.5,True)

##DIFFERENT FROM BEAM HAND ORIENTATION!
def BeamEndDirection(beam):
	stPt = beam.Location.Curve.GetEndPoint(0)
	endPt = beam.Location.Curve.GetEndPoint(0)
	return stPt - endPt

def LocCurveDirection(beam):
	return beam.Location.Curve.Direction

def BeamDirection(beam):
	return beam.HandOrientation
	
"""
def RaybounceFaceWalls(center, direction, view):
	try:
		filter = ElementClassFilter(Wall);
		refIntersector = ReferenceIntersector(filter, FindReferenceTarget.Face, view);
		referenceWithContext = refIntersector.FindNearest(center, direction)
		reference = referenceWithContext.GetReference()
		return [reference, reference.GlobalPoint]
	except:
		return "not found"
		"""
		
def RaybounceFaceWalls(center, direction, view, beam):
	try:
		filter = ElementClassFilter(Wall);
		refIntersector = ReferenceIntersector(filter, FindReferenceTarget.Face, view);
		referenceWithContext = refIntersector.FindNearest(center, direction)
		reference = referenceWithContext.GetReference()
		if abs(center.DistanceTo(reference.GlobalPoint)) - BeamLength(beam)*0.5 <2: # 2 feet!!
			return [reference, reference.GlobalPoint]
		else:
			return "too far"
	except:
		return "not found"


def GetBeamZOffset(element):
	p = element.get_Parameter(BuiltInParameter.Z_OFFSET_VALUE)
	ProjectUnits = p.DisplayUnitType
	zOffset = UnitUtils.ConvertFromInternalUnits(p.AsDouble(),ProjectUnits)
	return -zOffset
	
	


e = UnwrapElement(IN[0])

excelData = IN[1]

class beamType:
	def __init__(self, beamType, CiPType, plateH, plateW):
		self.beamType = beamType
		self.CiPType = CiPType
		self.plateH = plateH
		self.plateW = plateW
	def printOut(self):
		return [self.beamType, self.CiPType, self.plateH, self.plateW]


def returnCiPInstance(beam, beamTypes):
	for b in beamTypes:
		if b.beamType in beam.Name:
			return b
		
	

beamTypes = []

for list in excelData:
	beamTypes.append(beamType(list[0],list[1],list[2],list[3]))
"""
for b in beamTypes:
	if b.beamType in elements[0].Name:
		OUT = b.printOut()
"""




def returnCiPInstance(beam, beamTypes):
	for b in beamTypes:
		if b.beamType in beam.Name:
			return b
			
CiPs = []

for list in excelData:
	CiPs.append(beamType(list[0],list[1],list[2],list[3]))

cip = returnCiPInstance(e, beamTypes)

center = BeamMidPoint(e)

dir = LocCurveDirection(e)

def BeamLength(beam):
	return beam.Location.Curve.Length


def SetCipInstaParam(beam, cipInstance, CiPs, offset):
	cipType = returnCiPInstance(beam, CiPs)
	errors = []
	try:
		p = cipInstance.LookupParameter("Plate Height")
		p.Set(cipType.plateH/304.8)
	except:
		errors.append("height failed")
	try:
		p = cipInstance.LookupParameter("Plate Width")
		p.Set(cipType.plateW/304.8)
	except:
		errors.append("width failed")
	try:
		p = cipInstance.LookupParameter("Top Offset")
		p.Set((GetBeamZOffset(beam)-offset)/304.8)
	except:
		errors.append("zOffset failed")
	try:
		p = cipInstance.LookupParameter("Beam Level")
		workPlane = beam.LookupParameter("Work Plane").AsString()
		p.Set(workPlane)
	except:
		errors.append("Beam level failed")
	try:
		p = cipInstance.LookupParameter("Beam Type")
		p.Set(beam.Name)
	except:
		errors.append("Beam Type failed")
	try:
		p = cipInstance.LookupParameter("CiP Type")
		p.Set(cipType.CiPType)
	except:
		errors.append("CiP type failed")
	try:
		level = beam.LookupParameter("Reference Level").AsElementId()
		p = cip.LookupParameter("Schedule Level")
		p.Set(level)
	except:
		errors.append("Schedule Level failed")
	return errors

rb = RaybounceFaceWalls(center, -dir, doc.ActiveView, e)
	
fs = UnwrapElement(IN[2])

rayDirection = BeamDirection(e)

view = doc.ActiveView

center = BeamMidPoint(e)
rayDirection = BeamDirection(e)
rb = RaybounceFaceWalls(center, rayDirection, view, e) #ray in beam direction from beam mid point
reverseDirection = -rayDirection
rc = RaybounceFaceWalls(center, reverseDirection, view, e) #ray in beam inverse direction from beam mid point

	
errors = []


def wallOrientation(wall):
	return doc.GetElement(wall).Orientation
	
TransactionManager.Instance.EnsureInTransaction(doc)

try:
	cip = doc.Create.NewFamilyInstance.Overloads[Reference, XYZ, XYZ, FamilySymbol](rb[0], rb[1], rayDirection.CrossProduct(XYZ(0,0,1)), fs)
except:
	pass
	cip = doc.Create.NewFamilyInstance.Overloads[Reference, XYZ, XYZ, FamilySymbol](rc[0], rc[1], rayDirection.CrossProduct(XYZ(0,0,1)), fs)


		
errors.append(SetCipInstaParam(e, cip, CiPs, 10))
				
TransactionManager.Instance.TransactionTaskDone()


OUT = rb, rc, wallOrientation(rb[0]), e.LookupParameter("Reference Level").AsElementId()
# ----------------------------------------

select_model_elements_2 = DSModelElementsSelection()  # 18 picked in the model
code_block_5 = CodeBlock { "CiP3"; }
importExcel_2 = Data.ImportExcel(file=file_from_path, sheetName=code_block_5)
refresh_2 = BoolSelector(true)

# group: CiP3
python_script_3 = Python(IN[0]=select_model_elements_2, IN[1]=byName, IN[2]=importExcel_2, IN[3]=code_block_3, IN[4]=code_block_4, IN[5]=refresh_2)
# ---------- python_script_3.python (220 lines) ----------
import clr

clr.AddReference('RevitAPI')
from Autodesk.Revit.DB import *
from Autodesk.Revit.DB.Structure import *

clr.AddReference('RevitAPIUI')
from Autodesk.Revit.UI import *

clr.AddReference('System')
from System.Collections.Generic import List

clr.AddReference('RevitNodes')
import Revit
clr.ImportExtensions(Revit.GeometryConversion)
clr.ImportExtensions(Revit.Elements)

clr.AddReference('RevitServices')
import RevitServices
from RevitServices.Persistence import DocumentManager
from RevitServices.Transactions import TransactionManager

import math

doc = DocumentManager.Instance.CurrentDBDocument
uidoc=DocumentManager.Instance.CurrentUIApplication.ActiveUIDocument

### INPUTS###

if isinstance(IN[0], list):
	elements = UnwrapElement(IN[0])
else:
	elements = [UnwrapElement(IN[0])]

fs = UnwrapElement(IN[1])

excelData = IN[2]

plateOffset = IN[3]

###


class beamType:
	def __init__(self, beamType, CiPType, plateH, plateW):
		self.beamType = beamType
		self.CiPType = CiPType
		self.plateH = plateH
		self.plateW = plateW
	def printOut(self):
		return [self.beamType, self.CiPType, self.plateH, self.plateW]


#loop through the beam types instances and find the instance by its name
def returnCiPInstance(beam, beamTypes):
	for b in beamTypes:
		if b.beamType in beam.Name:
			return b
			
CiPs = []

for list in excelData:
	CiPs.append(beamType(list[0],list[1],list[2],list[3]))
	

def BeamLength(beam):
	return beam.Location.Curve.Length

def BeamMidPoint(beam):
	return beam.Location.Curve.Evaluate(0.5,True)

##DIFFERENT FROM BEAM HAND ORIENTATION!
def BeamEndDirection(beam):
	stPt = beam.Location.Curve.GetEndPoint(0)
	endPt = beam.Location.Curve.GetEndPoint(0)
	return stPt - endPt

def LocCurveDirection(beam):
	return beam.Location.Curve.Direction

def BeamDirection(beam):
	return beam.HandOrientation
	

def RaybounceFaceWalls(center, direction, view, beam):
	try:
		filter = ElementClassFilter(Wall);
		refIntersector = ReferenceIntersector(filter, FindReferenceTarget.Face, view);
		referenceWithContext = refIntersector.FindNearest(center, direction)
		reference = referenceWithContext.GetReference()
		if abs(center.DistanceTo(reference.GlobalPoint)) - BeamLength(beam)*0.5 < IN[4]: # in feet!!
			return [reference, reference.GlobalPoint]
		else:
			return "too far"
	except:
		return "not found"


def GetBeamZOffset(element):
	p = element.get_Parameter(BuiltInParameter.Z_OFFSET_VALUE)
	ProjectUnits = p.DisplayUnitType
	zOffset = UnitUtils.ConvertFromInternalUnits(p.AsDouble(),ProjectUnits)
	return -zOffset
	
	

def SetCipInstaParam(beam, cipInstance, CiPs, offset):
	cipType = returnCiPInstance(beam, CiPs)
	errors = []
	try:
		p = cipInstance.LookupParameter("Plate Height")
		p.Set(cipType.plateH/304.8)
	except:
		errors.append("height failed")
	try:
		p = cipInstance.LookupParameter("Plate Width")
		p.Set(cipType.plateW/304.8)
	except:
		errors.append("width failed")
	try:
		p = cipInstance.LookupParameter("Top Offset")
		p.Set((GetBeamZOffset(beam)-offset)/304.8)
	except:
		errors.append("zOffset failed")
	try:
		p = cipInstance.LookupParameter("Beam Level")
		workPlane = beam.LookupParameter("Work Plane").AsString()
		p.Set(workPlane)
	except:
		errors.append("Beam level failed")
	try:
		p = cipInstance.LookupParameter("Beam Type")
		p.Set(beam.Name)
	except:
		errors.append("Beam Type failed")
	try:
		p = cipInstance.LookupParameter("CiP Type")
		p.Set(cipType.CiPType)
	except:
		errors.append("CiP type failed")
	try:
		level = beam.LookupParameter("Reference Level").AsElementId()
		p = cipInstance.LookupParameter("Schedule Level")
		p.Set(level)
	except:
		errors.append("CiP Schedule Level failed")
	return errors






view = doc.ActiveView


beams = []
points = []


void = []
errors = []
references = []
cipList = []

rbs = []
rcs = []

TransactionManager.Instance.EnsureInTransaction(doc)

for e in elements:
	if e.Category.Name == "Structural Framing":
		try:
			beams.append(e)
			center = BeamMidPoint(e)
			rayDirection = BeamDirection(e)
			rb = RaybounceFaceWalls(center, rayDirection, view, e) #ray in beam direction from beam mid point
			rbs.append(rb)
			reverseDirection = -rayDirection
			rc = RaybounceFaceWalls(center, reverseDirection, view, e) #ray in beam inverse direction from beam mid point
			rcs.append(rcs)
			if rb != "not found" and rc != "not found":
				references.append(rb[0])
				points.append(rb[1])
				references.append(rc[0])
				points.append(rc[1])
				cip1 = doc.Create.NewFamilyInstance.Overloads[Reference, XYZ, XYZ, FamilySymbol](rb[0], rb[1], rayDirection.CrossProduct(XYZ(0,0,1)), fs)
				errors.append(SetCipInstaParam(e, cip1, CiPs, plateOffset))	#SetCipInstaParam(beam, cipInstance, beamTypes, offset):
				cipList.append(cip1)
				cip2 = doc.Create.NewFamilyInstance.Overloads[Reference, XYZ, XYZ, FamilySymbol](rc[0], rc[1], reverseDirection.CrossProduct(XYZ(0,0,1)), fs)
				errors.append(SetCipInstaParam(e, cip2, CiPs, plateOffset))
				cipList.append(cip2)
				errors.append("beam start point")
				errors.append("beam end point")
			elif rc != "not found":
				references.append(rc[0])
				points.append(rc[1])
				cip = doc.Create.NewFamilyInstance.Overloads[Reference, XYZ, XYZ, FamilySymbol](rc[0], rc[1], reverseDirection.CrossProduct(XYZ(0,0,1)), fs)
				errors.append(SetCipInstaParam(e, cip, CiPs, plateOffset))
				cipList.append(cip)
				errors.append("reverse direction")
			elif rb != "not found":
				references.append(rb[0])
				points.append(rb[1])
				references.append(rc[0])
				points.append(rc[1])
				cip = doc.Create.NewFamilyInstance.Overloads[Reference, XYZ, XYZ, FamilySymbol](rb[0], rb[1], rayDirection.CrossProduct(XYZ(0,0,1)), fs)
				errors.append(SetCipInstaParam(e, cip, CiPs, plateOffset))
				cipList.append(cip)
			else:
				errors.append("wall not found")
		except:
			errors.append("Uh-oh something went wrong")
			

TransactionManager.Instance.TransactionTaskDone()
#p = [p.ToPoint() for p in points]


OUT = beams, errors, references, points, cipList, rbs, rcs
# ----------------------------------------

code_block_6 = CodeBlock {  }
select_model_element_2 = DSModelElementSelection()  # 1 picked in the model
code_block_7 = CodeBlock { "Schedule Level"; }
levels = Levels(index=11)
setParameterByName = Element.SetParameterByName(element=select_model_element_2, parameterName=code_block_7, value=levels)
