# Dynamo graph Clearance Height for Multiple Elements.dyn (Dynamo 1.3.2.2480)

# group: Select all lower level elements of type floor
levels = Levels("01")
all_elements_at_level = ElementsAtLevel(levels)
string = StringInput("Floor")
removeIfNot = RemoveIfNot(all_elements_at_level, string)

# group: Select all upper level elements of type floor
levels_2 = Levels("02")
all_elements_at_level_2 = ElementsAtLevel(levels_2)
string_2 = StringInput("Floor")
removeIfNot_2 = RemoveIfNot(all_elements_at_level_2, string_2)

create = List.Create(removeIfNot, removeIfNot_2)

# group: Min point of Upper Level Element
boundingBox = Element.BoundingBox(removeIfNot_2)
minPoint = BoundingBox.MinPoint(boundingBox)

# group: Max point of Lower Level Element
boundingBox_2 = Element.BoundingBox(removeIfNot)
maxPoint = BoundingBox.MaxPoint(boundingBox_2)

# group: Gets Z.Vector Length between the upper and lower point
byTwoPoints = Vector.ByTwoPoints(start=minPoint, end=maxPoint)
Z = Vector.Z(byTwoPoints)
abs = Math.Abs(Z)

# group: Minimum allowable clearance
number_slider = DoubleSlider(2750, range=0..4000 step 0.1)

# group: Determines if the distance between the points is less than allowable clearance
lt = abs < number_slider
filterByBoolMask = List.FilterByBoolMask(list=create@L2, mask=lt)

# group: Colour the model element
code_block = CodeBlock()
# ---------- code_block.designscript (5 lines) ----------
//red
a=0;
r=255;
g=0;
b=0;
# ----------------------------------------
byARGB = Color.ByARGB(a=code_block.a, r=code_block.r, g=code_block.g, b=code_block.b)
# note: Red if less than allowable
overrideColorInView = Element.OverrideColorInView(element=filterByBoolMask.in, color=byARGB)
code_block_2 = CodeBlock()
# ---------- code_block_2.designscript (5 lines) ----------
//green
a=0;
r=0;
g=255;
b=0;
# ----------------------------------------
byARGB_2 = Color.ByARGB(a=code_block_2.a, r=code_block_2.r, g=code_block_2.g, b=code_block_2.b)
# note: Green if greater than allowable
overrideColorInView_2 = Element.OverrideColorInView(element=filterByBoolMask.out, color=byARGB_2)
