# Dynamo graph Create Beam Tags _GB_02.dyn (Dynamo 2.0.1.5055)

select_model_elements = DSModelElementsSelection()  # 4 picked in the model

# group: Find Beam Centre points
getLocation = Element.GetLocation(element=select_model_elements)
code_block = CodeBlock { 0.5; }
pointAtParameter = Curve.PointAtParameter(curve=getLocation, param=code_block)
X = Point.X(point=pointAtParameter)
Y = Point.Y(point=pointAtParameter)

# group: obtain point for tags
startPoint = Curve.StartPoint(curve=getLocation)
endPoint = Curve.EndPoint(curve=getLocation)
byTwoPoints = Vector.ByTwoPoints(start=startPoint, end=endPoint)
ZAxis = Vector.ZAxis()
cross = Vector.Cross(vector=byTwoPoints, cross=ZAxis)
normalized = Vector.Normalized(vector=cross)
code_block_2 = CodeBlock(vct=cross) { vct.Y>0; }
code_block_3 = CodeBlock { 350; }
code_block_4 = CodeBlock { -350; }
if_ = If(test=code_block_2, true=code_block_3, false=code_block_4)
scale = Vector.Scale(vector=normalized, scale_factor=if_)
translate = Geometry.Translate(geometry=pointAtParameter, direction=scale)

# group: Interrogate beam parameters and returns text string level
string = StringInput("Reference Level")
getParameterValueByName = Element.GetParameterValueByName(element=select_model_elements, parameterName=string)
string_from_object = FromObject(obj=getParameterValueByName)
code_block_5 = CodeBlock { 17; }
code_block_6 = CodeBlock { 2; }
substring = String.Substring(str=string_from_object, startIndex=code_block_5, length=code_block_6)

levels = Watch(substring)

# group: Define PB or SB
string_2 = StringInput("Structural Usage")
getParameterValueByName_2 = Element.GetParameterValueByName(element=select_model_elements, parameterName=string_2)
watch = Watch(getParameterValueByName_2)
code_block_7 = CodeBlock { 4; }
lt = watch < code_block_7
string_from_object_2 = FromObject(obj=lt)
string_3 = StringInput("false")
string_4 = StringInput("SB")
replace = String.Replace(str=string_from_object_2, searchFor=string_3, replaceWith=string_4)
string_5 = StringInput("true")
string_6 = StringInput("PB")
replace_2 = String.Replace(str=replace, searchFor=string_5, replaceWith=string_6)

pb_or_sb = Watch(replace_2)

# group: Coordinates at Grid A-01
code_block_8 = CodeBlock { -67286.598; }
code_block_9 = CodeBlock { 559.835; }

# group: distance from base point to beam CL's
sub = X - code_block_8
code_block_10 = CodeBlock { 1000; }
div = sub / code_block_10
sub_2 = Y - code_block_9
code_block_11 = CodeBlock { 1000; }
div_2 = sub_2 / code_block_11

x_coordinates = Watch(div)
abs = Math.Abs(number=x_coordinates)
code_block_12 = CodeBlock { 0; }

# group: TURNS "1" INTO "01"
round = Math.Round(number=abs, digits=code_block_12)
string_from_object_3 = FromObject(obj=round)
string_7 = StringInput(".")
split = String.Split(str=string_from_object_3, separater0=string_7)
code_block_13 = CodeBlock { 0; }
getItemAtIndex = List.GetItemAtIndex(list=split, index=code_block_13, lacing=Longest)
code_block_14 = CodeBlock { 2; }
string_8 = StringInput("0")
padLeft = String.PadLeft(str=getItemAtIndex, newWidth=code_block_14, padChars=string_8)

y_coordinates = Watch(div_2)

# group: TURNS "1" INTO "01"
round_2 = Math.Round(number=y_coordinates, digits=code_block_12)
string_from_object_4 = FromObject(obj=round_2)
string_9 = StringInput(".")
split_2 = String.Split(str=string_from_object_4, separater0=string_9)
code_block_15 = CodeBlock { 0; }
getItemAtIndex_2 = List.GetItemAtIndex(list=split_2, index=code_block_15, lacing=Longest)
code_block_16 = CodeBlock { 2; }
string_10 = StringInput("0")
padLeft_2 = String.PadLeft(str=getItemAtIndex_2, newWidth=code_block_16, padChars=string_10)

list_create = List.Create(item0=levels, item1=pb_or_sb, item2=padLeft, item3=padLeft_2)
transpose = List.Transpose(lists=list_create)
concat = String.Concat(string0=transpose)
watch_2 = Watch(concat)
flatten = List.Flatten(list=watch_2)
string_11 = StringInput("Mark")

# group: original
getParameterValueByName_3 = Element.GetParameterValueByName(element=select_model_elements, parameterName=string_11)

python_script = Python(IN[0]=flatten, IN[1]=getParameterValueByName_3, IN[2]=select_model_elements)
# ---------- python_script.python (21 lines) ----------
existing = IN[1]
new = IN[0]
elements = IN[2]

notChanged = []
changed = []
newers = []


for i in range(0,len(elements)):
	if existing[i] == new[i]:
		notChanged.append(elements[i])
	elif existing[i] == "":
		newers.append(elements[i])
	else:
		changed.append(elements[i])



# Assign your output to the OUT variable.
OUT = notChanged, changed, newers
# ----------------------------------------
flatten_2 = List.Flatten(list=python_script)
current = Document.Current()
activeView = Document.ActiveView(document=current)
code_block_17 = CodeBlock { 1; }

# group: Get Identity_Type Mark
string_12 = StringInput("Identity_Type Mark")
get_type_parameter = Custom[Get Type Parameter](element=select_model_elements, parameterName=string_12)  # This node will retrieve a type parameter by its name.
string_from_object_5 = FromObject(obj=get_type_parameter)
watch_3 = Watch(string_from_object_5)

# group: Obtain Element ID
id = Element.Id(element=select_model_elements)
string_from_object_6 = FromObject(obj=id)

unique_beam_id = Watch(string_from_object_6)
code_block_18 = CodeBlock { 1; }
chop = List.Chop(list=unique_beam_id, lengths=code_block_18)

# group: Determine Beam size
string_13 = StringInput("Type")
getParameterValueByName_4 = Element.GetParameterValueByName(element=select_model_elements, parameterName=string_13)
string_from_object_7 = FromObject(obj=getParameterValueByName_4)
code_block_19 = CodeBlock { 13; }
code_block_20 = CodeBlock { 25; }
substring_2 = String.Substring(str=string_from_object_7, startIndex=code_block_19, length=code_block_20)
string_14 = StringInput(",")
split_3 = String.Split(str=substring_2, separater0=string_14)
code_block_21 = CodeBlock { 0; }
getItemAtIndex_3 = List.GetItemAtIndex(list=split_3, index=code_block_21, lacing=Longest)

beam_sizes = Watch(getItemAtIndex_3)
code_block_22 = CodeBlock { 1; }
chop_2 = List.Chop(list=beam_sizes, lengths=code_block_22)
code_block_23 = CodeBlock { 1; }
chop_3 = List.Chop(list=levels, lengths=code_block_23)
code_block_24 = CodeBlock { 1; }
chop_4 = List.Chop(list=pb_or_sb, lengths=code_block_24)
code_block_25 = CodeBlock { 5; }
round_3 = Math.Round(number=abs, digits=code_block_25)
code_block_26 = CodeBlock { 1; }
chop_5 = List.Chop(list=round_3, lengths=code_block_26)
round_4 = Math.Round(number=y_coordinates, digits=code_block_25)
code_block_27 = CodeBlock { 1; }
chop_6 = List.Chop(list=round_4, lengths=code_block_27)
list_create_2 = List.Create(item0=chop, item1=chop_2, item2=chop_3, item3=chop_4, item4=chop_5, item5=chop_6)

# group: Write to Excel
file_path = Filename(".\CQT Beam Schedule.xlsx")
string_15 = StringInput("Sheet1")
code_block_28 = CodeBlock { 2; }
code_block_29 = CodeBlock { [0..5]; }
transpose_2 = List.Transpose(lists=code_block_29)
exportExcel = Data.ExportExcel(filePath=file_path, sheetName=string_15, startRow=code_block_28, startCol=transpose_2, data=list_create_2)  # frozen

# group: For Upper Ground Only Replaces Gr with UG
string_16 = StringInput("Gr")
string_17 = StringInput("UG")
replace_3 = String.Replace(str=substring, searchFor=string_16, replaceWith=string_17)

# group: For L5 mezz Only Replaces 05 with 05M
string_18 = StringInput("05")
string_19 = StringInput("05M")
replace_4 = String.Replace(str=substring, searchFor=string_18, replaceWith=string_19)

python_script_2 = Python()  # unwired: IN[0], IN[1]
# ---------- python_script_2.python (32 lines) ----------
import clr
clr.AddReference('RevitAPI')
from Autodesk.Revit.DB import *

clr.AddReference("RevitNodes")
import Revit
clr.ImportExtensions(Revit.Elements)

clr.AddReference("RevitServices")
import RevitServices
from RevitServices.Persistence import DocumentManager
from RevitServices.Transactions import TransactionManager

doc = DocumentManager.Instance.CurrentDBDocument
items = UnwrapElement(IN[0])
view = doc.ActiveView
booleans = []

override = OverrideGraphicSettings()

TransactionManager.Instance.EnsureInTransaction(doc)
for item in items:
	try:
		view.SetElementOverrides(item.Id, override)
		booleans.append(True)
	except: booleans.append(False)
TransactionManager.Instance.TransactionTaskDone()

if IN[1] == False:
	OUT = items
else:
	OUT = "Do nothing"
# ----------------------------------------
string_20 = StringInput("Mark")
setParameterByName = Element.SetParameterByName(parameterName=string_20, value=getParameterValueByName_3)  # unwired: element
python_script_3 = Python(IN[0]=translate)  # frozen
# ---------- python_script_3.python (148 lines) ----------
import clr

clr.AddReference("System.Windows.Forms")
from System.Windows.Forms import Application, Button, Form, Label, TextBox, CheckBox, FolderBrowserDialog, OpenFileDialog, DialogResult, ComboBox, FormBorderStyle, FormStartPosition

clr.AddReference("System.Drawing")
from System.Drawing import *

clr.AddReference("System")
from System import EventHandler


clr.AddReference("RevitAPIUI")
from Autodesk.Revit.UI import IExternalEventHandler, ExternalEvent

clr.AddReference("RevitAPI")
from Autodesk.Revit.DB import ElementId, TagMode, TagOrientation
from Autodesk.Revit.DB import Transaction
# noinspection PyUnresolvedReferences
from Autodesk.Revit.Exceptions import InvalidOperationException


clr.AddReference('RevitServices')
from RevitServices.Persistence import DocumentManager
from RevitServices.Transactions import TransactionManager

# Import Element wrapper extension methods
clr.AddReference("RevitNodes")
import Revit
clr.ImportExtensions(Revit.Elements)

# Import geometry conversion extension methods
clr.ImportExtensions(Revit.GeometryConversion)


global result
result = None


doc = DocumentManager.Instance.CurrentDBDocument
uidoc = DocumentManager.Instance.CurrentUIApplication.ActiveUIDocument
uiapp = DocumentManager.Instance.CurrentUIApplication
app = uiapp.Application

elements = UnwrapElement(IN[0])


def setMarkBack(elements):
	for ele in elements:
		p = ele.LookupParameter("Comments")
		p.Set("O")
	

def close(form):
	form.Close()


def Button2Click(sender, e):
	form.Close()
	OUT = 1
	

label1 = Label();
button1 = Button();
button2 = Button();

# A simple WPF form used to call the ExternalEvent
class ModelessForm(Form):
	"""
	Simple modeless form sample
	"""
	def __init__(self):
		self.Text = 'Data-Shapes | Multi Input UI ++'
		self.output = []
		self.values = []
		self.cancelled = False


	def setclose(self, sender, event):
		cbindexread = 0
		if sender.Name != "Cancel":
			self.values = "Accepted"
		else:
			self.values = "Cancelled"
			self.cancelled = True
		self.Close()
	
	def reset(self, sender, event):
		pass



# Let's launch our beautiful and useful form !
form = ModelessForm()
form.TopMost = True
form.Height = 150
form.Width = 300
form.StartPosition = FormStartPosition.CenterScreen



label1.Location = Point(12, 9);
label1.Name = "label1";
label1.Size = Size(219, 63);
label1.TabIndex = 2;
label1.Text = "You are updating the beam tags. Click OK to accept the changes or Cancel to discard them";
label1.UseCompatibleTextRendering = True;


button1.Location = Point(10, 75);
button1.Name = "button1";
button1.Size = Size(88, 32);
button1.TabIndex = 0;
button1.Text = "OK";
button1.UseCompatibleTextRendering = True;
button1.UseVisualStyleBackColor = True;
button1.Click += EventHandler(form.setclose);

button2.DialogResult = DialogResult.Cancel;
button2.Location = Point(134, 75);
button2.Name = "Cancel";
button2.Size = Size(88, 32);
button2.TabIndex = 1;
button2.Text = "Cancel";
button2.UseCompatibleTextRendering = True;
button2.UseVisualStyleBackColor = True;
button2.Click += EventHandler(form.setclose);

form.Controls.Add(button1);
form.Controls.Add(button2);
form.Controls.Add(label1);




if True:
	Application.Run(form)
	result = form.values

if result != "Cancelled":
	"ok"
else:
	t = Transaction(doc, "Failing script")
	t.Start()
	setMarkBack(elements)
	t.Commit()

OUT = form.cancelled, Application
# ----------------------------------------
code_block_30 = CodeBlock { null; }

# group: Tag Element with new tag
family_types = FamilyTypes(index=48)
string_21 = StringInput("Mark")
setParameterByName_2 = Element.SetParameterByName(element=flatten_2, parameterName=string_21, value=flatten)
python_script_4 = Python(IN[0]=translate, IN[1]=family_types, IN[2]=setParameterByName_2, IN[3]=activeView, IN[4]=code_block_30, IN[5]=code_block_17)
# ---------- python_script_4.python (264 lines) ----------
#Copyright(c) 2015, Konrad K Sobon
# @arch_laboratory, http://archi-lab.net

import clr

clr.AddReference("System.Windows.Forms")
from System.Windows.Forms import Application, Button, Label, TextBox, CheckBox, FolderBrowserDialog, OpenFileDialog, DialogResult, ComboBox, FormBorderStyle, FormStartPosition
from System.Windows.Forms import Form as winForm

clr.AddReference("System.Drawing")
from System.Drawing import Point as dPoint
from System.Drawing import Size as dSize

clr.AddReference("System")
from System import EventHandler


clr.AddReference("RevitAPIUI")
from Autodesk.Revit.UI import IExternalEventHandler, ExternalEvent


# Import RevitAPI
clr.AddReference("RevitAPI")
#from Autodesk.Revit.DB import *
from Autodesk.Revit.DB import ElementId, TagMode, TagOrientation, Color, OverrideGraphicSettings, BuiltInParameter
from Autodesk.Revit.Exceptions import InvalidOperationException



# Import Element wrapper extension methods
clr.AddReference("RevitNodes")
import Revit
clr.ImportExtensions(Revit.Elements)

# Import geometry conversion extension methods
clr.ImportExtensions(Revit.GeometryConversion)

# Import DocumentManager and TransactionManager
clr.AddReference("RevitServices")
from RevitServices.Persistence import DocumentManager
from RevitServices.Transactions import TransactionManager

doc = DocumentManager.Instance.CurrentDBDocument

#The inputs to this node will be stored as a list in the IN variable.
dataEnteringNode = IN

locationPts = UnwrapElement(IN[0])
tagType = UnwrapElement(IN[1])
elements = UnwrapElement(IN[2])

link = None
	
RunIt = IN[5]

views = UnwrapElement(IN[3])

def setMarkBack(elements):
	for ele in elements:
		p = ele.LookupParameter("Comments")
		p.Set("O")
	

def close(form):
	form.Close()

label1 = Label();
button1 = Button();
button2 = Button();
button3 = Button();
button4 = Button();

# A simple WPF form used to call the ExternalEvent
class ModelessForm(winForm):
	"""
	Simple modeless form sample
	"""
	def __init__(self):
		self.Text = 'Place Beam Tags'
		self.output = []
		self.values = []
		self.cancelled = False
		self.tagType = None
		self.locationPts = []
		self.result = ''
		self.elements = []
		self.view = None


	def setclose(self, sender, event):
		cbindexread = 0
		ResetOverrideColor(self.elements,self.view)
		if sender.Name != "Cancel":
			self.values = "Accepted"
		else:
			self.values = "Cancelled"
			self.cancelled = True
		self.Close()
	
	def reset(self, sender, event):
		pass
		
	def PlaceTags(self, sender, event):
		tagTypeId = self.tagType.Id
		errorReport = None
		tags = []
		try:
			TransactionManager.Instance.EnsureInTransaction(doc)
			for i, j in zip(elements, self.locationPts):
				location = toRvtPoint(j)
				tag = doc.Create.NewTag(self.view, i, False, TagMode.TM_ADDBY_CATEGORY, TagOrientation.Horizontal, location)
				tag.ChangeTypeId(tagTypeId)
				tags.append(tag)
			TransactionManager.Instance.TransactionTaskDone()
			self.values = tags
			#self.Close()
		except:
			self.result = "RunIt is set to False."
	
	def DeleteTags(self, sender, event):
		if len(self.values) > 0:
			for v in self.values:
				try:
					doc.Delete(v.Id)
				except:
					self.result = "oh-ho"
					
	def RefreshTags(self, sender, event):
		[Refresh(t) for t in self.values]
		
	def ColorOverride(self, sender, event):
		colorGreen = Color(0,255,0)
		self.result = OverrideColor(self.elements,colorGreen,self.view)
		#self.view.get_Parameter(BuiltInParameter.MODEL_GRAPHICS_STYLE ).Set( 1 )
		#self.view.get_Parameter(BuiltInParameter.MODEL_GRAPHICS_STYLE ).Set( 4 )


# Let's launch our beautiful and useful form !
form = ModelessForm()
form.TopMost = True
form.Height = 150
form.Width = 380
form.StartPosition = FormStartPosition.CenterScreen

form.tagType = tagType
form.locationPts = locationPts
form.elements = elements
form.view = views


label1.Location = dPoint(12, 75);
label1.Name = "label1";
label1.Size = dSize(300, 63);
label1.TabIndex = 2;
label1.Text = "You are updating the beam tags." +"\n" + "Click OK to accept the changes.";
label1.UseCompatibleTextRendering = True;


button1.Location = dPoint(10, 20);
button1.Name = "button1";
button1.Size = dSize(88, 32);
button1.TabIndex = 0;
button1.Text = "Place Tags";
button1.UseCompatibleTextRendering = True;
button1.UseVisualStyleBackColor = True;
button1.Click += EventHandler(form.PlaceTags);


button2.Location = dPoint(134, 20);
button2.Name = "Cancel";
button2.Size = dSize(88, 32);
button2.TabIndex = 1;
button2.Text = "Remove Tags";
button2.UseCompatibleTextRendering = True;
button2.UseVisualStyleBackColor = True;
button2.Click += EventHandler(form.DeleteTags);



button3.Location = dPoint(250, 20);
button3.Name = "Ok";
button3.Size = dSize(88, 32);
button3.TabIndex = 1;
button3.Text = "Override Color";
button3.UseCompatibleTextRendering = True;
button3.UseVisualStyleBackColor = True;
button3.Click += EventHandler(form.ColorOverride);





button4.Location = dPoint(250, 70);
button4.Name = "Close";
button4.Size = dSize(88, 32);
button4.TabIndex = 1;
button4.Text = "OK";
button4.UseCompatibleTextRendering = True;
button4.UseVisualStyleBackColor = True;
button4.Click += EventHandler(form.setclose);



form.Controls.Add(button1);
form.Controls.Add(button2);
form.Controls.Add(button3);
form.Controls.Add(button4);
form.Controls.Add(label1);


#Application.Run(form)
#result = form.values


def toRvtPoint(point):
	return point.ToXyz()



def Refresh(element):
	element.Pinned = True
	element.Pinned = False



def OverrideColor(elements, color, view):
	booleans = []
	override = OverrideGraphicSettings()
	#override.SetProjectionLineColor(color)
	override.SetProjectionFillColor (color)
	override.SetProjectionFillPatternId(ElementId(19))
	
	TransactionManager.Instance.EnsureInTransaction(doc)
	for item in elements:
		try:
			view.SetElementOverrides(item.Id, override)
			booleans.append(True)
		except: booleans.append(False)
	TransactionManager.Instance.TransactionTaskDone()
	return booleans
	

def ResetOverrideColor(elements, view):
booleans = []
override = OverrideGraphicSettings()

TransactionManager.Instance.EnsureInTransaction(doc)
for item in elements:
	try:
		view.SetElementOverrides(item.Id, override)
		booleans.append(True)
	except: booleans.append(False)
TransactionManager.Instance.TransactionTaskDone()
return booleans



Application.Run(form)

#Assign your output to the OUT variable

OUT = form.values, form.result
	
#form = ModelessForm()
# ----------------------------------------

create_annotation_tag = Custom[Create Annotation Tag](TagLocations=translate, TagType=family_types, Elements=setParameterByName_2, Views=activeView, RunIt=code_block_17)  # frozen; This node will create an annotation tag at a given location, of given type and in a supplied view. If only single view is supplied then all tags will be created in that view.
code_block_31 = CodeBlock(a=python_script) { a[0]; }
code_block_32 = CodeBlock { color1 = Color.ByARGB(255, 0, 255, 0); color2 = Color.ByARGB(255, 255, 255, 0); color3 = Color.ByARGB(255, 255, 0, 0); }

# group: Not changed - Green
overrideColorInView = Element.OverrideColorInView(element=code_block_31, color=code_block_32.color1)  # frozen

code_block_33 = CodeBlock(a=python_script) { a[1]; }

# group: Changed - Yellow
overrideColorInView_2 = Element.OverrideColorInView(element=code_block_33, color=code_block_32.color2)  # frozen

code_block_34 = CodeBlock(a=python_script) { a[2]; }

# group: New - Red
overrideColorInView_3 = Element.OverrideColorInView(element=code_block_34, color=code_block_32.color3)  # frozen

list_create_3 = List.Create(item0=overrideColorInView, item1=overrideColorInView_2, item2=overrideColorInView_3)
resetElementOverrides = Custom[View.ResetElementOverrides](element=flatten_2, view=activeView)  # frozen; Resets all overrides for an element in a given view
select_model_elements_2 = DSModelElementsSelection()  # 2 picked in the model
python_script_5 = Python(IN[0]=select_model_elements_2, IN[1]=activeView)  # frozen
# ---------- python_script_5.python (34 lines) ----------
import clr
clr.AddReference('RevitAPI')
from Autodesk.Revit.DB import Color, OverrideGraphicSettings, ElementId, BuiltInParameter

clr.AddReference("RevitNodes")
import Revit
clr.ImportExtensions(Revit.Elements)

clr.AddReference("RevitServices")
import RevitServices
from RevitServices.Persistence import DocumentManager
from RevitServices.Transactions import TransactionManager

doc = DocumentManager.Instance.CurrentDBDocument
items = UnwrapElement(IN[0])
view = UnwrapElement(IN[1])
booleans = []

def OverrideColor(elements, color, v):
	override = OverrideGraphicSettings()
	override.SetProjectionLineColor(color)
#	override.SetProjectionFillPatternId(ElementId(19))
	
	TransactionManager.Instance.EnsureInTransaction(doc)
	for item in elements:
		try:
			v.SetElementOverrides(item.Id, override)
			booleans.append(True)
		except: booleans.append(False)
	v.get_Parameter(BuiltInParameter.MODEL_GRAPHICS_STYLE ).Set( 1 )
	TransactionManager.Instance.TransactionTaskDone()


OUT = OverrideColor(items, Color(0,255,255),view)
# ----------------------------------------
