# Dynamo graph Create Beam Tags _GB_05.dyn (Dynamo 2.0.1.5055)

select_model_elements = DSModelElementsSelection()  # 3 picked in the model

# group: Find Beam Centre points
getLocation = Element.GetLocation(element=select_model_elements)
code_block = CodeBlock { 0.5; }
pointAtParameter = Curve.PointAtParameter(curve=getLocation, param=code_block)
X = Point.X(point=pointAtParameter)
Y = Point.Y(point=pointAtParameter)

# group: obtain point for tags
startPoint = Curve.StartPoint(curve=getLocation)
endPoint = Curve.EndPoint(curve=getLocation)
byTwoPoints = Vector.ByTwoPoints(start=startPoint, end=endPoint)
ZAxis = Vector.ZAxis()
cross = Vector.Cross(vector=byTwoPoints, cross=ZAxis)
normalized = Vector.Normalized(vector=cross)
code_block_2 = CodeBlock(vct=cross) { vct.Y>0; }
code_block_3 = CodeBlock { 350; }
code_block_4 = CodeBlock { -350; }
if_ = If(test=code_block_2, true=code_block_3, false=code_block_4)
scale = Vector.Scale(vector=normalized, scale_factor=if_)
translate = Geometry.Translate(geometry=pointAtParameter, direction=scale)

code_block_5 = CodeBlock(a=select_model_elements) { a; }
current = Document.Current()
activeView = Document.ActiveView(document=current)
code_block_6 = CodeBlock { 1; }

# group: Get Identity_Type Mark
string = StringInput("Identity_Type Mark")
get_type_parameter = Custom[Get Type Parameter](element=select_model_elements, parameterName=string)  # This node will retrieve a type parameter by its name.
string_from_object = FromObject(obj=get_type_parameter)
watch = Watch(string_from_object)

# group: Obtain Element ID
id = Element.Id(element=select_model_elements)
string_from_object_2 = FromObject(obj=id)

unique_beam_id = Watch(string_from_object_2)
code_block_7 = CodeBlock { 1; }
chop = List.Chop(list=unique_beam_id, lengths=code_block_7)

# group: Determine Beam size
string_2 = StringInput("Type")
getParameterValueByName = Element.GetParameterValueByName(element=select_model_elements, parameterName=string_2)
string_from_object_3 = FromObject(obj=getParameterValueByName)
code_block_8 = CodeBlock { 13; }
code_block_9 = CodeBlock { 25; }
substring = String.Substring(str=string_from_object_3, startIndex=code_block_8, length=code_block_9)
string_3 = StringInput(",")
split = String.Split(str=substring, separater0=string_3)
code_block_10 = CodeBlock { 0; }
getItemAtIndex = List.GetItemAtIndex(list=split, index=code_block_10, lacing=Longest)

beam_sizes = Watch(getItemAtIndex)
code_block_11 = CodeBlock { 1; }
chop_2 = List.Chop(list=beam_sizes, lengths=code_block_11)

# group: Interrogate beam parameters and returns text string level
string_4 = StringInput("Reference Level")
getParameterValueByName_2 = Element.GetParameterValueByName(element=select_model_elements, parameterName=string_4)
string_from_object_4 = FromObject(obj=getParameterValueByName_2)
code_block_12 = CodeBlock { 17; }
code_block_13 = CodeBlock { 2; }
substring_2 = String.Substring(str=string_from_object_4, startIndex=code_block_12, length=code_block_13)

levels = Watch(substring_2)
code_block_14 = CodeBlock { 1; }
chop_3 = List.Chop(list=levels, lengths=code_block_14)

# group: Define PB or SB
string_5 = StringInput("Structural Usage")
getParameterValueByName_3 = Element.GetParameterValueByName(element=select_model_elements, parameterName=string_5)
watch_2 = Watch(getParameterValueByName_3)
code_block_15 = CodeBlock { 4; }
lt = watch_2 < code_block_15
string_from_object_5 = FromObject(obj=lt)
string_6 = StringInput("false")
string_7 = StringInput("SB")
replace = String.Replace(str=string_from_object_5, searchFor=string_6, replaceWith=string_7)
string_8 = StringInput("true")
string_9 = StringInput("PB")
replace_2 = String.Replace(str=replace, searchFor=string_8, replaceWith=string_9)

pb_or_sb = Watch(replace_2)
code_block_16 = CodeBlock { 1; }
chop_4 = List.Chop(list=pb_or_sb, lengths=code_block_16)

# group: Coordinates at Grid A-01
code_block_17 = CodeBlock { -67286.598; }
code_block_18 = CodeBlock { 559.835; }

# group: distance from base point to beam CL's
sub = X - code_block_17
code_block_19 = CodeBlock { 1000; }
div = sub / code_block_19
sub_2 = Y - code_block_18
code_block_20 = CodeBlock { 1000; }
div_2 = sub_2 / code_block_20

x_coordinates = Watch(div)
abs = Math.Abs(number=x_coordinates)
code_block_21 = CodeBlock { 5; }
round = Math.Round(number=abs, digits=code_block_21)
code_block_22 = CodeBlock { 1; }
chop_5 = List.Chop(list=round, lengths=code_block_22)
y_coordinates = Watch(div_2)
round_2 = Math.Round(number=y_coordinates, digits=code_block_21)
code_block_23 = CodeBlock { 1; }
chop_6 = List.Chop(list=round_2, lengths=code_block_23)
list_create = List.Create(item0=chop, item1=chop_2, item2=chop_3, item3=chop_4, item4=chop_5, item5=chop_6)

# group: Write to Excel
file_path = Filename(".\CQT Beam Schedule.xlsx")
string_10 = StringInput("Sheet1")
code_block_24 = CodeBlock { 2; }
code_block_25 = CodeBlock { [0..5]; }
transpose = List.Transpose(lists=code_block_25)
exportExcel = Data.ExportExcel(filePath=file_path, sheetName=string_10, startRow=code_block_24, startCol=transpose, data=list_create)  # frozen

# group: For Upper Ground Only Replaces Gr with UG
string_11 = StringInput("Gr")
string_12 = StringInput("UG")
replace_3 = String.Replace(str=substring_2, searchFor=string_11, replaceWith=string_12)

# group: For L5 mezz Only Replaces 05 with 05M
string_13 = StringInput("05")
string_14 = StringInput("05M")
replace_4 = String.Replace(str=substring_2, searchFor=string_13, replaceWith=string_14)

code_block_26 = CodeBlock { ["eee","aaa","avv"]; }
python_script = Python(IN[1]=code_block_26)  # frozen; unwired: IN[0], IN[2]
# ---------- python_script.python (49 lines) ----------
import clr
clr.AddReference('RevitAPI')
from Autodesk.Revit.DB import *

clr.AddReference("RevitNodes")
import Revit
clr.ImportExtensions(Revit.Elements)

clr.AddReference("RevitServices")
import RevitServices
from RevitServices.Persistence import DocumentManager
from RevitServices.Transactions import TransactionManager

doc = DocumentManager.Instance.CurrentDBDocument
uidoc=DocumentManager.Instance.CurrentUIApplication.ActiveUIDocument


items = UnwrapElement(IN[0])
view = doc.ActiveView
booleans = []
tags = IN[1]

override = OverrideGraphicSettings()

def OverrideColor():
	booleans = []
	view = doc.ActiveView
	override = OverrideGraphicSettings()
	override.SetProjectionFillPatternId(ElementId(19))
	TransactionManager.Instance.EnsureInTransaction(doc)
	for elid in uidoc.Selection.GetElementIds():
		#override.SetProjectionFillColor(Color(color.Red,color.Green, color.Blue))
		override.SetProjectionFillColor(Color(255,0,0))
		try:
			view.SetElementOverrides(elid, override)
		except:
			"uh-oh to be implemented"
	TransactionManager.Instance.TransactionTaskDone()
	return booleans
	
def setMark():
	t = Transaction(doc, "Set Mark")
	t.Start()
	for elid,tag in zip(uidoc.Selection.GetElementIds(),tags):
		p = doc.GetElement(elid).LookupParameter("Comments")
		p.Set(p.AsString() + "(" + tag + ")")
	t.Commit()

OUT = setMark()
# ----------------------------------------
string_15 = StringInput("Mark")
string_16 = StringInput("Mark")

# group: original
getParameterValueByName_4 = Element.GetParameterValueByName(element=select_model_elements, parameterName=string_16)

setParameterByName = Element.SetParameterByName(parameterName=string_15, value=getParameterValueByName_4)  # unwired: element
python_script_2 = Python(IN[0]=translate)  # frozen
# ---------- python_script_2.python (148 lines) ----------
import clr

clr.AddReference("System.Windows.Forms")
from System.Windows.Forms import Application, Button, Form, Label, TextBox, CheckBox, FolderBrowserDialog, OpenFileDialog, DialogResult, ComboBox, FormBorderStyle, FormStartPosition

clr.AddReference("System.Drawing")
from System.Drawing import *

clr.AddReference("System")
from System import EventHandler


clr.AddReference("RevitAPIUI")
from Autodesk.Revit.UI import IExternalEventHandler, ExternalEvent

clr.AddReference("RevitAPI")
from Autodesk.Revit.DB import ElementId, TagMode, TagOrientation
from Autodesk.Revit.DB import Transaction
# noinspection PyUnresolvedReferences
from Autodesk.Revit.Exceptions import InvalidOperationException


clr.AddReference('RevitServices')
from RevitServices.Persistence import DocumentManager
from RevitServices.Transactions import TransactionManager

# Import Element wrapper extension methods
clr.AddReference("RevitNodes")
import Revit
clr.ImportExtensions(Revit.Elements)

# Import geometry conversion extension methods
clr.ImportExtensions(Revit.GeometryConversion)


global result
result = None


doc = DocumentManager.Instance.CurrentDBDocument
uidoc = DocumentManager.Instance.CurrentUIApplication.ActiveUIDocument
uiapp = DocumentManager.Instance.CurrentUIApplication
app = uiapp.Application

elements = UnwrapElement(IN[0])


def setMarkBack(elements):
	for ele in elements:
		p = ele.LookupParameter("Comments")
		p.Set("O")
	

def close(form):
	form.Close()


def Button2Click(sender, e):
	form.Close()
	OUT = 1
	

label1 = Label();
button1 = Button();
button2 = Button();

# A simple WPF form used to call the ExternalEvent
class ModelessForm(Form):
	"""
	Simple modeless form sample
	"""
	def __init__(self):
		self.Text = 'Data-Shapes | Multi Input UI ++'
		self.output = []
		self.values = []
		self.cancelled = False


	def setclose(self, sender, event):
		cbindexread = 0
		if sender.Name != "Cancel":
			self.values = "Accepted"
		else:
			self.values = "Cancelled"
			self.cancelled = True
		self.Close()
	
	def reset(self, sender, event):
		pass



# Let's launch our beautiful and useful form !
form = ModelessForm()
form.TopMost = True
form.Height = 150
form.Width = 300
form.StartPosition = FormStartPosition.CenterScreen



label1.Location = Point(12, 9);
label1.Name = "label1";
label1.Size = Size(219, 63);
label1.TabIndex = 2;
label1.Text = "You are updating the beam tags. Click OK to accept the changes or Cancel to discard them";
label1.UseCompatibleTextRendering = True;


button1.Location = Point(10, 75);
button1.Name = "button1";
button1.Size = Size(88, 32);
button1.TabIndex = 0;
button1.Text = "OK";
button1.UseCompatibleTextRendering = True;
button1.UseVisualStyleBackColor = True;
button1.Click += EventHandler(form.setclose);

button2.DialogResult = DialogResult.Cancel;
button2.Location = Point(134, 75);
button2.Name = "Cancel";
button2.Size = Size(88, 32);
button2.TabIndex = 1;
button2.Text = "Cancel";
button2.UseCompatibleTextRendering = True;
button2.UseVisualStyleBackColor = True;
button2.Click += EventHandler(form.setclose);

form.Controls.Add(button1);
form.Controls.Add(button2);
form.Controls.Add(label1);




if True:
	Application.Run(form)
	result = form.values

if result != "Cancelled":
	"ok"
else:
	t = Transaction(doc, "Failing script")
	t.Start()
	setMarkBack(elements)
	t.Commit()

OUT = form.cancelled, Application
# ----------------------------------------
code_block_27 = CodeBlock { 0; }

# group: TURNS "1" INTO "01"
round_3 = Math.Round(number=abs, digits=code_block_27)
string_from_object_6 = FromObject(obj=round_3)
string_17 = StringInput(".")
split_2 = String.Split(str=string_from_object_6, separater0=string_17)
code_block_28 = CodeBlock { 0; }
getItemAtIndex_2 = List.GetItemAtIndex(list=split_2, index=code_block_28, lacing=Longest)
code_block_29 = CodeBlock { 2; }
string_18 = StringInput("0")
padLeft = String.PadLeft(str=getItemAtIndex_2, newWidth=code_block_29, padChars=string_18)

# group: TURNS "1" INTO "01"
round_4 = Math.Round(number=y_coordinates, digits=code_block_27)
string_from_object_7 = FromObject(obj=round_4)
string_19 = StringInput(".")
split_3 = String.Split(str=string_from_object_7, separater0=string_19)
code_block_30 = CodeBlock { 0; }
getItemAtIndex_3 = List.GetItemAtIndex(list=split_3, index=code_block_30, lacing=Longest)
code_block_31 = CodeBlock { 2; }
string_20 = StringInput("0")
padLeft_2 = String.PadLeft(str=getItemAtIndex_3, newWidth=code_block_31, padChars=string_20)

list_create_2 = List.Create(item0=levels, item1=pb_or_sb, item2=padLeft, item3=padLeft_2)
transpose_2 = List.Transpose(lists=list_create_2)
concat = String.Concat(string0=transpose_2)
watch_3 = Watch(concat)
flatten = List.Flatten(list=watch_3)
python_script_3 = Python(IN[0]=flatten, IN[1]=getParameterValueByName_4, IN[2]=select_model_elements)
# ---------- python_script_3.python (26 lines) ----------
import clr
clr.AddReference('RevitAPI')
from Autodesk.Revit.DB import Color, OverrideGraphicSettings, ElementId, BuiltInParameter, TextNote


existing = IN[1]
new = IN[0]
elements = IN[2]

notChanged = []
changed = []
newers = []

colors = []

for i in range(0,len(elements)):
	if existing[i] == new[i]:
		colors.append(Color(0,255,0))
	elif existing[i] == "":
		colors.append(Color(255,0,0))
	else:
		colors.append(Color(255,255,0))


# Assign your output to the OUT variable.
OUT = colors
# ----------------------------------------
code_block_32 = CodeBlock { 2; }
code_block_33 = CodeBlock(newtags=flatten) { newtags; }
code_block_34 = CodeBlock(originalMarks=getParameterValueByName_4) { originalMarks; }

# group: Tag Element with new tag
family_types = FamilyTypes(index=48)
# note: IN[0] points
python_script_4 = Python(IN[0]=translate, IN[1]=family_types, IN[2]=code_block_5, IN[3]=activeView, IN[4]=python_script_3, IN[5]=code_block_32, IN[6]=code_block_33, IN[7]=code_block_34)  # frozen
# ---------- python_script_4.python (295 lines) ----------
#Copyright(c) 2015, Konrad K Sobon
# @arch_laboratory, http://archi-lab.net

import clr

clr.AddReference("System.Windows.Forms")
from System.Windows.Forms import Application, Button, Label, TextBox, CheckBox, FolderBrowserDialog, OpenFileDialog, DialogResult, ComboBox, FormBorderStyle, FormStartPosition
from System.Windows.Forms import Form as winForm

clr.AddReference("System.Drawing")
from System.Drawing import Point as dPoint
from System.Drawing import Size as dSize

clr.AddReference("System")
from System import EventHandler


clr.AddReference("RevitAPIUI")
from Autodesk.Revit.UI import IExternalEventHandler, ExternalEvent


# Import RevitAPI
clr.AddReference("RevitAPI")
#from Autodesk.Revit.DB import *
from Autodesk.Revit.DB import ElementId, TagMode, TagOrientation, Color, OverrideGraphicSettings, BuiltInParameter, TextNote
from Autodesk.Revit.Exceptions import InvalidOperationException



# Import Element wrapper extension methods
clr.AddReference("RevitNodes")
import Revit
clr.ImportExtensions(Revit.Elements)

# Import geometry conversion extension methods
clr.ImportExtensions(Revit.GeometryConversion)

# Import DocumentManager and TransactionManager
clr.AddReference("RevitServices")
from RevitServices.Persistence import DocumentManager
from RevitServices.Transactions import TransactionManager

doc = DocumentManager.Instance.CurrentDBDocument

#The inputs to this node will be stored as a list in the IN variable.
dataEnteringNode = IN

locationPts = UnwrapElement(IN[0])
tagType = UnwrapElement(IN[1])
elements = UnwrapElement(IN[2])

colors = IN[4]
	
RunIt = IN[5]

views = UnwrapElement(IN[3])

newMarksList = IN[6]

originalMarksList = IN[7]



label1 = Label();
button1 = Button();
button2 = Button();
button3 = Button();
button4 = Button();

# A simple WPF form used to call the ExternalEvent
class ModelessForm(winForm):
	"""
	Simple modeless form sample
	"""
	def __init__(self):
		self.Text = 'Place Beam Tags'
		self.output = []
		self.values = []
		self.cancelled = False
		self.tagType = None
		self.locationPts = []
		self.result = ''
		self.elements = []
		self.view = None
		self.colors = []
		self.newMarks = []
		self.originalMarks = []

	def setclose(self, sender, event):
		cbindexread = 0
		ResetOverrideColor(self.elements,self.view)
		DeleteNewTags(self.values)
		if sender.Name != "Cancel":
			self.values = "Accepted"
		else:
			self.values = "Cancelled"
			self.cancelled = True
		self.Close()
	
	def reset(self, sender, event):
		pass
		
	def PlaceTags(self, sender, event):
		setMark(self.elements, self.newMarks)
		tagTypeId = self.tagType.Id
		errorReport = None
		tags = []
		try:
			TransactionManager.Instance.EnsureInTransaction(doc)
			for i, j in zip(elements, self.locationPts):
				location = toRvtPoint(j)
				tag = doc.Create.NewTag(self.view, i, False, TagMode.TM_ADDBY_CATEGORY, TagOrientation.Horizontal, location)
				tag.ChangeTypeId(tagTypeId)
				tags.append(tag)
			TransactionManager.Instance.TransactionTaskDone()
			self.values = tags
			#self.Close()
		except:
			self.result = "RunIt is set to False."
				
					
	def RefreshTags(self, sender, event):
		[Refresh(t) for t in self.values]
		
	def ColorOverride(self, sender, event):
		self.result = OverrideColor(self.elements, self.colors, self.view)
		#self.view.get_Parameter(BuiltInParameter.MODEL_GRAPHICS_STYLE ).Set( 1 )
		#self.view.get_Parameter(BuiltInParameter.MODEL_GRAPHICS_STYLE ).Set( 4 )
	def AddTextNotes(self, sender, event):
		notes = []
		notes.append(PlaceTextNotes(self.locationPts, self.newMarks, self.view))
		self.values = notes
		
		
	def OriginalMark(self, sender, event):
		setMark(self.elements, self.originalMarks)
		ResetOverrideColor(self.elements,self.view)
		DeleteNewTags(self.values)
		self.values = "Cancelled"
		self.cancelled = True
		self.Close()
	

# Let's launch our beautiful and useful form !
form = ModelessForm()
form.TopMost = True
form.Height = 150
form.Width = 380
form.StartPosition = FormStartPosition.CenterScreen

form.tagType = tagType
form.locationPts = locationPts
form.elements = elements
form.view = views
form.colors = colors
form.newMarks = newMarksList
form.originalMarks = originalMarksList


label1.Location = dPoint(12, 75);
label1.Name = "label1";
label1.Size = dSize(300, 63);
label1.TabIndex = 2;
label1.Text = "You are updating the beam tags." +"\n" + "Click OK to accept the changes.";
label1.UseCompatibleTextRendering = True;


button1.Location = dPoint(10, 20);
button1.Name = "button1";
button1.Size = dSize(88, 32);
button1.TabIndex = 0;
button1.Text = "Place Tags";
button1.UseCompatibleTextRendering = True;
button1.UseVisualStyleBackColor = True;
button1.Click += EventHandler(form.PlaceTags);


button2.Location = dPoint(250, 70);
button2.Name = "Cancel";
button2.Size = dSize(88, 32);
button2.TabIndex = 1;
button2.Text = "Undo Changes";
button2.UseCompatibleTextRendering = True;
button2.UseVisualStyleBackColor = True;
button2.Click += EventHandler(form.OriginalMark);


button3.Location = dPoint(134, 20);
button3.Name = "Override";
button3.Size = dSize(88, 32);
button3.TabIndex = 1;
button3.Text = "Override Color";
button3.UseCompatibleTextRendering = True;
button3.UseVisualStyleBackColor = True;
button3.Click += EventHandler(form.ColorOverride);


button4.Location = dPoint(250, 20);
button4.Name = "OK";
button4.Size = dSize(88, 32);
button4.TabIndex = 1;
button4.Text = "OK";
button4.UseCompatibleTextRendering = True;
button4.UseVisualStyleBackColor = True;
button4.Click += EventHandler(form.setclose);



form.Controls.Add(button1);
form.Controls.Add(button2);
form.Controls.Add(button3);
form.Controls.Add(button4);
form.Controls.Add(label1);


#Application.Run(form)
#result = form.values


def toRvtPoint(point):
	return point.ToXyz()



def Refresh(element):
	element.Pinned = True
	element.Pinned = False




def OverrideColor(elements, colors, v):
	booleans = []
	override = OverrideGraphicSettings()
	override.SetProjectionFillPatternId(ElementId(19))
	TransactionManager.Instance.EnsureInTransaction(doc)
	for item,c in zip(elements,colors):
		#override.SetProjectionFillColor(Color(color.Red,color.Green, color.Blue))
		override.SetProjectionFillColor(c)
		try:
			v.SetElementOverrides(item.Id, override)
			booleans.append(True)
		except: booleans.append(False)
	#v.get_Parameter(BuiltInParameter.MODEL_GRAPHICS_STYLE ).Set( 1 )
	TransactionManager.Instance.TransactionTaskDone()
	return booleans
	

def ResetOverrideColor(elements, view):
	booleans = []
	override = OverrideGraphicSettings()
	TransactionManager.Instance.EnsureInTransaction(doc)
	for item in elements:
		try:
			view.SetElementOverrides(item.Id, override)
			booleans.append(True)
		except: booleans.append(False)
	TransactionManager.Instance.TransactionTaskDone()
	return booleans



def PlaceTextNotes(points, text, view):
	texts = []
	TransactionManager.Instance.EnsureInTransaction(doc)
	for p,t in zip(points,text):
		texts.append(TextNote.Create(doc, view.Id, p.ToXyz(), t, ElementId(1739)))
	TransactionManager.Instance.TransactionTaskDone()
	return texts

def setMark(elements, values):
	TransactionManager.Instance.EnsureInTransaction(doc)
	for ele,v in zip(elements,values):
		p = ele.LookupParameter("Mark")
		p.Set(v)
	TransactionManager.Instance.TransactionTaskDone()

def close(form):
	form.Close()

def DeleteNewTags(values):
	if len(values) > 0:
		for v in values:
			try:
				doc.Delete(v.Id)
			except:
				self.result = "oh-ho"
	
Application.Run(form)

#Assign your output to the OUT variable

OUT = form.values, form.result
	
#form = ModelessForm()
# ----------------------------------------

create_annotation_tag = Custom[Create Annotation Tag](TagLocations=translate, TagType=family_types, Elements=code_block_5, Views=activeView, RunIt=code_block_6)  # frozen; This node will create an annotation tag at a given location, of given type and in a supplied view. If only single view is supplied then all tags will be created in that view.
python_script_5 = Python(IN[0]=flatten, IN[1]=getParameterValueByName_4, IN[2]=select_model_elements)
# ---------- python_script_5.python (22 lines) ----------
existing = IN[1]
new = IN[0]
elements = IN[2]

notChanged = []
changed = []
newers = []

Color = []

for i in range(0,len(elements)):
	if existing[i] == new[i]:
		notChanged.append(elements[i])
	elif existing[i] == "":
		newers.append(elements[i])
	else:
		changed.append(elements[i])



# Assign your output to the OUT variable.
OUT = notChanged, changed, newers
# ----------------------------------------
flatten_2 = List.Flatten(list=python_script_5)
resetElementOverrides = Custom[View.ResetElementOverrides](element=flatten_2, view=activeView)  # frozen; Resets all overrides for an element in a given view
code_block_35 = CodeBlock { color1 = Color.ByARGB(255, 0, 255, 0); }
code_block_36 = CodeBlock(a=python_script_5) { a[0]; }
count = List.Count(list=code_block_36)
ofRepeatedItem = List.OfRepeatedItem(item=code_block_35, amount=count)
code_block_37 = CodeBlock { color1 = Color.ByARGB(255, 255, 255, 0); }
code_block_38 = CodeBlock(a=python_script_5) { a[1]; }
count_2 = List.Count(list=code_block_38)
ofRepeatedItem_2 = List.OfRepeatedItem(item=code_block_37, amount=count_2)
code_block_39 = CodeBlock { color1 = Color.ByARGB(255, 0, 255, 255); }
code_block_40 = CodeBlock(a=python_script_5) { a[2]; }
count_3 = List.Count(list=code_block_40)
ofRepeatedItem_3 = List.OfRepeatedItem(item=code_block_39, amount=count_3)
list_create_3 = List.Create(item0=ofRepeatedItem, item1=ofRepeatedItem_2, item2=ofRepeatedItem_3)
flatten_3 = List.Flatten(list=list_create_3)
python_script_6 = Python(IN[0]=flatten_2, IN[1]=activeView, IN[2]=flatten_3, IN[3]=translate, IN[4]=flatten)  # frozen
# ---------- python_script_6.python (46 lines) ----------
import clr
clr.AddReference('RevitAPI')
from Autodesk.Revit.DB import Color, OverrideGraphicSettings, ElementId, BuiltInParameter, TextNote

clr.AddReference("RevitNodes")
import Revit
clr.ImportExtensions(Revit.Elements)
clr.ImportExtensions(Revit.GeometryConversion)

clr.AddReference("RevitServices")
import RevitServices
from RevitServices.Persistence import DocumentManager
from RevitServices.Transactions import TransactionManager

doc = DocumentManager.Instance.CurrentDBDocument
items = UnwrapElement(IN[0])
view = UnwrapElement(IN[1])
booleans = []
colors = IN[2]
points = IN[3]
text = IN[4]


def OverrideColor(elements, color, v):
	override = OverrideGraphicSettings()
#	override.SetProjectionFillPatternId(ElementId(19))
	TransactionManager.Instance.EnsureInTransaction(doc)
	for item,color in zip(elements,colors):
		override.SetProjectionLineColor(Color(color.Red,color.Green, color.Blue))
		try:
			v.SetElementOverrides(item.Id, override)
			booleans.append(True)
		except: booleans.append(False)
	#v.get_Parameter(BuiltInParameter.MODEL_GRAPHICS_STYLE ).Set( 1 )
	TransactionManager.Instance.TransactionTaskDone()


def PlaceTextNotes(points, text):
	texts = []
	TransactionManager.Instance.EnsureInTransaction(doc)
	for p,t in zip(points,text):
		texts.append(TextNote.Create(doc, view.Id, p.ToXyz(), t, ElementId(1739)))
	TransactionManager.Instance.TransactionTaskDone()
	return texts
	
OUT = OverrideColor(items, colors, view)
# ----------------------------------------
boolean = BoolSelector(false)
python_script_7 = Python(IN[2]=code_block_26, IN[4]=boolean)  # unwired: IN[0], IN[1], IN[3]
# ---------- python_script_7.python (290 lines) ----------
import clr

clr.AddReference("System.Windows.Forms")
from System.Windows.Forms import Application, Button, Form, Label, TextBox, CheckBox, FolderBrowserDialog, OpenFileDialog, DialogResult, ComboBox, FormBorderStyle, FormStartPosition

clr.AddReference("System.Drawing")
from System.Drawing import Point as dPoint
from System.Drawing import Size as dSize


clr.AddReference("System")
from System import EventHandler


clr.AddReference("RevitAPIUI")
from Autodesk.Revit.UI import IExternalEventHandler, ExternalEvent, TaskDialog

clr.AddReference("RevitAPI")
from Autodesk.Revit.DB import Transaction, OverrideGraphicSettings, ElementId, Color
# noinspection PyUnresolvedReferences
from Autodesk.Revit.Exceptions import InvalidOperationException


clr.AddReference('RevitServices')
from RevitServices.Persistence import DocumentManager


global result



doc = DocumentManager.Instance.CurrentDBDocument
uidoc = DocumentManager.Instance.CurrentUIApplication.ActiveUIDocument

elementsDynamo = UnwrapElement(IN[4])

newTagsList = IN[2]

def ResetOverrideColor(elements):
	view = doc.ActiveView
	booleans = []
	override = OverrideGraphicSettings()
	t = Transaction(doc, "Undo")
	t.Start()
	for item in elements:
		try:
			view.SetElementOverrides(item, override)
			booleans.append(True)
		except: booleans.append(False)
	t.Commit()
	TaskDialog.Show("result", str(len(elements)))
	return booleans
	

def setTemporaryMark(newTags):
	elements = uidoc.Selection.GetElementIds()
	form.addElements(elements)
	t = Transaction(doc, "Set Mark")
	t.Start()
	for elid,tag in zip(elements, newTags):
		p = doc.GetElement(elid).LookupParameter("Comments")
		form.originalMarks.append(p.AsString())
		p.Set(p.AsString() + "(" + tag + ")")
	t.Commit()
	

def assignMark(elements, newTags):
	t = Transaction(doc, "Set Mark")
	t.Start()
	for elid,tag in zip(elements, newTags):
		p = doc.GetElement(elid).LookupParameter("Comments")
		p.Set(tag)
	t.Commit()



def test(nothing):
	elements = uidoc.Selection.GetElementIds()
	form.elements = elements


def delete_elements():
	t = Transaction(doc, "Failing script")
	t.Start()
	override = OverrideGraphicSettings()
	override.SetProjectionFillPatternId(ElementId(19))
	for elid,tag in zip(uidoc.Selection.GetElementIds(),tags):
		p = doc.GetElement(elid).LookupParameter("Comments")
		p.Set(p.AsString() + "(" + tag + ")")
	t.Commit()
	return "done"


def OverrideColor():
	booleans = []
	view = doc.ActiveView
	override = OverrideGraphicSettings()
	override.SetProjectionFillPatternId(ElementId(19))
	t = Transaction(doc, "Overide color")
	t.Start()
	elements = uidoc.Selection.GetElementIds()
	form.addOverride(elements)
	for elid in elements:
		#override.SetProjectionFillColor(Color(color.Red,color.Green, color.Blue))
		override.SetProjectionFillColor(Color(255,0,0))
		try:
			view.SetElementOverrides(elid, override)
		except:
			"uh-oh to be implemented"
	t.Commit()
	return booleans


def close(form):
	form.Close()


def Button2Click(sender, e):
	form.Close()
	OUT = 1


class CustomizableEvent:
    def __init__(self):
        self.function_or_method = None
        self.args = ()
        self.kwargs = {}

    def raised_method(self):
        self.function_or_method(*self.args, **self.kwargs)

    def raise_event(self, function_or_method, *args, **kwargs):
        self.args = args
        self.kwargs = kwargs
        self.function_or_method = function_or_method
        custom_event.Raise()

customizable_event = CustomizableEvent()

# Create a subclass of IExternalEventHandler
class CustomHandler(IExternalEventHandler):
    def Execute(self, application):
        try:
            customizable_event.raised_method()
        except InvalidOperationException:
            # If you don't catch this exeption Revit may crash.
            print("InvalidOperationException catched")

    # noinspection PyMethodMayBeStatic, PyPep8Naming
    def GetName(self):
        return "Execute an function or method in a IExternalHandler"


# Create an handler instance and his associated ExternalEvent
custom_handler = CustomHandler()
custom_event = ExternalEvent.Create(custom_handler)



label1 = Label();
button1 = Button();
button2 = Button();
button3 = Button();
button4 = Button();

# A simple WPF form used to call the ExternalEvent
class ModelessForm(Form):
	"""
	Simple modeless form sample
	"""
	def __init__(self):
		self.Text = 'Place Beam Tags'
		self.elements = []
		self.originalMarks = []
		self.view = None
		self.values = []
		self.override = []
		self.result = ""
		self.Show()
	
	def addElements(self, items):
		for i in items:
			self.elements.append(i)
			
	def addOverride(self, items):
		for i in items:
			self.override.append(i)

	
	def acceptChanges(self, sender, e):		
		CustomizableEvent.raise_event(customizable_event, ResetOverrideColor, self.override)
		CustomizableEvent.raise_event(customizable_event, assignMark, self.elements, newTagsList)
		self.Close()
	
	def undoChanges(self, sender, e):
		CustomizableEvent.raise_event(customizable_event, ResetOverrideColor, self.override)
		CustomizableEvent.raise_event(customizable_event, assignMark, self.elements, self.originalMarks)
		self.Close()
		
	def PlaceTags(self, sender, e):
		CustomizableEvent.raise_event(customizable_event, setTemporaryMark, newTagsList)
	
	def ColorOverride(self, sender, e):
		CustomizableEvent.raise_event(customizable_event, OverrideColor)
		
	
	
	def delete_click(self, sender, e):
		# This Raise() method launch a signal to Revit to tell him you want to do something in the API context
		CustomizableEvent.raise_event(customizable_event, delete_elements)
		
	def myTest(self, sender, e):
		CustomizableEvent.raise_event(customizable_event, test, "aa")
		
	def Original(self, sender, e):
		CustomizableEvent.raise_event(customizable_event, delete_elements)
		
		
		
# Let's launch our beautiful and useful form !
form = ModelessForm()
form.TopMost = True
form.view = doc.ActiveView

form.TopMost = True
form.Height = 150
form.Width = 380
form.StartPosition = FormStartPosition.CenterScreen


label1.Location = dPoint(12, 75);
label1.Name = "label1";
label1.Size = dSize(300, 63);
label1.TabIndex = 2;
label1.Text = "You are updating the beam tags." +"\n" + "Click OK to accept the changes.";
label1.UseCompatibleTextRendering = True;


button1.Location = dPoint(10, 20);
button1.Name = "button1";
button1.Size = dSize(88, 32);
button1.TabIndex = 0;
button1.Text = "New Tags";
button1.UseCompatibleTextRendering = True;
button1.UseVisualStyleBackColor = True;
button1.Click += EventHandler(form.PlaceTags);


button2.Location = dPoint(250, 70);
button2.Name = "Cancel";
button2.Size = dSize(88, 32);
button2.TabIndex = 1;
button2.Text = "Undo Changes";
button2.UseCompatibleTextRendering = True;
button2.UseVisualStyleBackColor = True;
button2.Click += EventHandler(form.undoChanges);


button3.Location = dPoint(134, 20);
button3.Name = "Override";
button3.Size = dSize(88, 32);
button3.TabIndex = 1;
button3.Text = "Override Color";
button3.UseCompatibleTextRendering = True;
button3.UseVisualStyleBackColor = True;
button3.Click += EventHandler(form.ColorOverride);


button4.Location = dPoint(250, 20);
button4.Name = "OK";
button4.Size = dSize(88, 32);
button4.TabIndex = 1;
button4.Text = "Apply Changes";
button4.UseCompatibleTextRendering = True;
button4.UseVisualStyleBackColor = True;
button4.Click += EventHandler(form.acceptChanges);



form.Controls.Add(button1);
form.Controls.Add(button2);
form.Controls.Add(button3);
form.Controls.Add(button4);
form.Controls.Add(label1);

#result = form.values



OUT = form.elements, form.override
# ----------------------------------------
code_block_41 = CodeBlock { 1; }
python_script_8 = Python()  # unwired: IN[0]
# ---------- python_script_8.python (28 lines) ----------
class ModelessForm():
	"""
	Simple modeless form sample
	"""
	def __init__(self):
		self.Text = 'Place Beam Tags'
		self.elements = []
		self.originalMarks = []
		self.view = None
		self.values = []
		self.result = ""

	
	def addElements(self, items):
		for i in items:
			self.elements.append(i)

form = ModelessForm()

elements = [1,2,3]
items = [4,5,6]
#form.elements.append(elements)

form.addElements(elements)
form.addElements(items)

# Assign your output to the OUT variable.
OUT = form.elements
# ----------------------------------------
