# Dynamo graph Create Beam Tags _GB_06.dyn (Dynamo 2.0.1.5055)

code_block = CodeBlock { ["eee","aaa","avv"]; }
boolean = BoolSelector(true)
python_script = Python(IN[2]=code_block, IN[4]=boolean)  # unwired: IN[0], IN[1], IN[3]
# ---------- python_script.python (291 lines) ----------
import clr

clr.AddReference("System.Windows.Forms")
from System.Windows.Forms import Application, Button, Form, Label, TextBox, CheckBox, FolderBrowserDialog, OpenFileDialog, DialogResult, ComboBox, FormBorderStyle, FormStartPosition

clr.AddReference("System.Drawing")
from System.Drawing import Point as dPoint
from System.Drawing import Size as dSize


clr.AddReference("System")
from System import EventHandler


clr.AddReference("RevitAPIUI")
from Autodesk.Revit.UI import IExternalEventHandler, ExternalEvent, TaskDialog

clr.AddReference("RevitAPI")
from Autodesk.Revit.DB import Transaction, OverrideGraphicSettings, ElementId, Color
# noinspection PyUnresolvedReferences
from Autodesk.Revit.Exceptions import InvalidOperationException


clr.AddReference('RevitServices')
from RevitServices.Persistence import DocumentManager


global result



doc = DocumentManager.Instance.CurrentDBDocument
uidoc = DocumentManager.Instance.CurrentUIApplication.ActiveUIDocument

elementsDynamo = UnwrapElement(IN[4])

newTagsList = IN[2]

def ResetOverrideColor(elements):
	v = doc.ActiveView
	booleans = []
	override = OverrideGraphicSettings()
	t = Transaction(doc, "Undo")
	t.Start()
	for item in elements:
		try:
			v.SetElementOverrides(item, override)
			booleans.append(True)
		except:
			booleans.append(False)
	t.Commit()
	TaskDialog.Show("result", str( len(elements) ) )
	return booleans
	

def setTemporaryMark(newTags):
	elements = uidoc.Selection.GetElementIds()
	form.addElements(elements)
	t = Transaction(doc, "Set Mark")
	t.Start()
	for elid,tag in zip(elements, newTags):
		p = doc.GetElement(elid).LookupParameter("Comments")
		form.originalMarks.append(p.AsString())
		p.Set(p.AsString() + "(" + tag + ")")
	t.Commit()
	

def assignMark(elements, newTags):
	t = Transaction(doc, "Set Mark")
	t.Start()
	for elid,tag in zip(elements, newTags):
		p = doc.GetElement(elid).LookupParameter("Comments")
		p.Set(tag)
	t.Commit()



def test(nothing):
	elements = uidoc.Selection.GetElementIds()
	form.elements = elements


def delete_elements():
	t = Transaction(doc, "Failing script")
	t.Start()
	override = OverrideGraphicSettings()
	override.SetProjectionFillPatternId(ElementId(19))
	for elid,tag in zip(uidoc.Selection.GetElementIds(),tags):
		p = doc.GetElement(elid).LookupParameter("Comments")
		p.Set(p.AsString() + "(" + tag + ")")
	t.Commit()
	return "done"


def OverrideColor():
	booleans = []
	view = doc.ActiveView
	override = OverrideGraphicSettings()
	override.SetProjectionFillPatternId(ElementId(19))
	t = Transaction(doc, "Overide color")
	t.Start()
	elements = uidoc.Selection.GetElementIds()
	form.addOverride(elements)
	for elid in elements:
		#override.SetProjectionFillColor(Color(color.Red,color.Green, color.Blue))
		override.SetProjectionFillColor(Color(255,0,0))
		try:
			view.SetElementOverrides(elid, override)
		except:
			"uh-oh to be implemented"
	t.Commit()
	return booleans


def close(form):
	form.Close()


def Button2Click(sender, e):
	form.Close()
	OUT = 1


class CustomizableEvent:
    def __init__(self):
        self.function_or_method = None
        self.args = ()
        self.kwargs = {}

    def raised_method(self):
        self.function_or_method(*self.args, **self.kwargs)

    def raise_event(self, function_or_method, *args, **kwargs):
        self.args = args
        self.kwargs = kwargs
        self.function_or_method = function_or_method
        custom_event.Raise()

customizable_event = CustomizableEvent()

# Create a subclass of IExternalEventHandler
class CustomHandler(IExternalEventHandler):
    def Execute(self, application):
        try:
            customizable_event.raised_method()
        except InvalidOperationException:
            # If you don't catch this exeption Revit may crash.
            print("InvalidOperationException catched")

    # noinspection PyMethodMayBeStatic, PyPep8Naming
    def GetName(self):
        return "Execute an function or method in a IExternalHandler"


# Create an handler instance and his associated ExternalEvent
custom_handler = CustomHandler()
custom_event = ExternalEvent.Create(custom_handler)



label1 = Label();
button1 = Button();
button2 = Button();
button3 = Button();
button4 = Button();

# A simple WPF form used to call the ExternalEvent
class ModelessForm(Form):
	"""
	Simple modeless form sample
	"""
	def __init__(self):
		self.Text = 'Place Beam Tags'
		self.elements = []
		self.originalMarks = []
		self.view = None
		self.values = []
		self.override = []
		self.result = ""
		self.Show()
	
	def addElements(self, items):
		for i in items:
			self.elements.append(i)
			
	def addOverride(self, items):
		for i in items:
			self.override.append(i)

	
	def acceptChanges(self, sender, e):		
		CustomizableEvent.raise_event(customizable_event, ResetOverrideColor, self.override)
		CustomizableEvent.raise_event(customizable_event, assignMark, self.override, newTagsList) #change self.override to self.elements
		self.Close()
	
	def undoChanges(self, sender, e):
		CustomizableEvent.raise_event(customizable_event, assignMark, self.elements, self.originalMarks)
		CustomizableEvent.raise_event(customizable_event, ResetOverrideColor, self.override)
		self.Close()
		
	def PlaceTags(self, sender, e):
		CustomizableEvent.raise_event(customizable_event, setTemporaryMark, newTagsList)
	
	def ColorOverride(self, sender, e):
		CustomizableEvent.raise_event(customizable_event, OverrideColor)
		
	
	
	def delete_click(self, sender, e):
		# This Raise() method launch a signal to Revit to tell him you want to do something in the API context
		CustomizableEvent.raise_event(customizable_event, delete_elements)
		
	def myTest(self, sender, e):
		CustomizableEvent.raise_event(customizable_event, test, "aa")
		
	def Original(self, sender, e):
		CustomizableEvent.raise_event(customizable_event, delete_elements)
		
		
		
# Let's launch our beautiful and useful form !
form = ModelessForm()
form.TopMost = True
form.view = doc.ActiveView

form.TopMost = True
form.Height = 150
form.Width = 380
form.StartPosition = FormStartPosition.CenterScreen


label1.Location = dPoint(12, 75);
label1.Name = "label1";
label1.Size = dSize(300, 63);
label1.TabIndex = 2;
label1.Text = "You are updating the beam tags." +"\n" + "Click OK to accept the changes.";
label1.UseCompatibleTextRendering = True;


button1.Location = dPoint(10, 20);
button1.Name = "button1";
button1.Size = dSize(88, 32);
button1.TabIndex = 0;
button1.Text = "New Tags";
button1.UseCompatibleTextRendering = True;
button1.UseVisualStyleBackColor = True;
button1.Click += EventHandler(form.PlaceTags);


button2.Location = dPoint(250, 70);
button2.Name = "Cancel";
button2.Size = dSize(88, 32);
button2.TabIndex = 1;
button2.Text = "Undo Changes";
button2.UseCompatibleTextRendering = True;
button2.UseVisualStyleBackColor = True;
button2.Click += EventHandler(form.undoChanges);


button3.Location = dPoint(134, 20);
button3.Name = "Override";
button3.Size = dSize(88, 32);
button3.TabIndex = 1;
button3.Text = "Override Color";
button3.UseCompatibleTextRendering = True;
button3.UseVisualStyleBackColor = True;
button3.Click += EventHandler(form.ColorOverride);


button4.Location = dPoint(250, 20);
button4.Name = "OK";
button4.Size = dSize(88, 32);
button4.TabIndex = 1;
button4.Text = "Apply Changes";
button4.UseCompatibleTextRendering = True;
button4.UseVisualStyleBackColor = True;
button4.Click += EventHandler(form.acceptChanges);



form.Controls.Add(button1);
form.Controls.Add(button2);
form.Controls.Add(button3);
form.Controls.Add(button4);
form.Controls.Add(label1);

#result = form.values



OUT = form.elements, form.override
# ----------------------------------------
code_block_2 = CodeBlock { 1; }
python_script_2 = Python()  # unwired: IN[0]
# ---------- python_script_2.python (56 lines) ----------
import clr

clr.AddReference("System.Windows.Forms")
from System.Windows.Forms import Application, Button, Form, Label, TextBox, CheckBox, FolderBrowserDialog, OpenFileDialog, DialogResult, ComboBox, FormBorderStyle, FormStartPosition

clr.AddReference("System.Drawing")
from System.Drawing import Point as dPoint
from System.Drawing import Size as dSize


clr.AddReference("System")
from System import EventHandler


clr.AddReference("RevitAPIUI")
from Autodesk.Revit.UI import IExternalEventHandler, ExternalEvent, TaskDialog

clr.AddReference("RevitAPI")
from Autodesk.Revit.DB import Transaction, OverrideGraphicSettings, ElementId, Color
# noinspection PyUnresolvedReferences
from Autodesk.Revit.Exceptions import InvalidOperationException


clr.AddReference('RevitServices')
from RevitServices.Persistence import DocumentManager


global result
doc = DocumentManager.Instance.CurrentDBDocument
uidoc = DocumentManager.Instance.CurrentUIApplication.ActiveUIDocument

def ResetOverrideColor(elements):
	view = doc.ActiveView
	booleans = []
	override = OverrideGraphicSettings()
	t = Transaction(doc, "Undo")
	t.Start()
	for item in elements:
		view.SetElementOverrides(item, override)
		booleans.append(True)
	t.Commit()
	#TaskDialog.Show("result", str(len(elements)))
	return booleans
	
elements = uidoc.Selection.GetElementIds()

form = []

for i in elements:
	form.append(i)





OUT = elements, form, ResetOverrideColor(form)
# ----------------------------------------
select_model_elements = DSModelElementsSelection()  # 2 picked in the model
