# Dynamo graph Create Beam Tags _GB_07.dyn (Dynamo 2.0.1.5055)

code_block = CodeBlock { ["eee","aaa","avv"]; }
boolean = BoolSelector(false)
python_script = Python(IN[0]=code_block, IN[4]=boolean)  # unwired: IN[1], IN[2], IN[3]
# ---------- python_script.python (250 lines) ----------
import clr

clr.AddReference("System.Windows.Forms")
from System.Windows.Forms import Application, Button, Form, Label, TextBox, CheckBox, FolderBrowserDialog, OpenFileDialog, DialogResult, ComboBox, FormBorderStyle, FormStartPosition

clr.AddReference("System.Drawing")
from System.Drawing import Point as dPoint
from System.Drawing import Size as dSize


clr.AddReference("System")
from System import EventHandler


clr.AddReference("RevitAPIUI")
from Autodesk.Revit.UI import IExternalEventHandler, ExternalEvent, TaskDialog

clr.AddReference("RevitAPI")
from Autodesk.Revit.DB import Transaction, OverrideGraphicSettings, ElementId, Color
# noinspection PyUnresolvedReferences
from Autodesk.Revit.Exceptions import InvalidOperationException


clr.AddReference('RevitServices')
from RevitServices.Persistence import DocumentManager


global result



doc = DocumentManager.Instance.CurrentDBDocument
uidoc = DocumentManager.Instance.CurrentUIApplication.ActiveUIDocument

elementsDynamo = UnwrapElement(IN[4])

newTagsList = IN[0]

def TagAndOverride(newTags):
	elementsIds = uidoc.Selection.GetElementIds()
	form.addElements(elementsIds)
	t = Transaction(doc, "Set Tag and Override")
	t.Start()
	setTemporaryMark(elementsIds, newTags)
	OverrideColor(elementsIds)
	t.Commit()
	#TaskDialog.Show("resu;t", ":Tagg")



def DiscardChanges(elements, originalMarks):
	t = Transaction(doc, "Discard changes")
	t.Start()
	ResetOverrideColor(elements)
	assignMark(elements, originalMarks)
	t.Commit()
	

def AcceptChanges(elements, newTags):
	t = Transaction(doc, "Cancel operation")
	t.Start()
	ResetOverrideColor(elements)
	assignMark(elements, newTags)
	t.Commit()
	
	

def ResetOverrideColor(elements):
	v = doc.ActiveView
	booleans = []
	override = OverrideGraphicSettings()	
	for item in elements:
		try:
			v.SetElementOverrides(item, override)
			booleans.append(True)
		except:
			booleans.append(False)
	#TaskDialog.Show("result", str( len(elements) ) )
	return booleans
	

def setTemporaryMark(elements, newTags):
	for elid,tag in zip(elements, newTags):
		p = doc.GetElement(elid).LookupParameter("Mark")
		form.originalMarks.append(p.AsString())
		p.Set(p.AsString() + "(" + tag + ")")
	

def assignMark(elements, newTags):
	for elid,tag in zip(elements, newTags):
		p = doc.GetElement(elid).LookupParameter("Mark")
		p.Set(tag)


def OverrideColor(elements):
	booleans = []
	view = doc.ActiveView
	override = OverrideGraphicSettings()
	override.SetProjectionFillPatternId(ElementId(19))
	for elid in elements:
		override.SetProjectionFillColor(Color(255,0,0))
		try:
			view.SetElementOverrides(elid, override)
		except:
			"uh-oh to be implemented"
	return booleans


def close(form):
	form.Close()




class CustomizableEvent:
    def __init__(self):
        self.function_or_method = None
        self.args = ()
        self.kwargs = {}

    def raised_method(self):
        self.function_or_method(*self.args, **self.kwargs)

    def raise_event(self, function_or_method, *args, **kwargs):
        self.args = args
        self.kwargs = kwargs
        self.function_or_method = function_or_method
        custom_event.Raise()

customizable_event = CustomizableEvent()

# Create a subclass of IExternalEventHandler
class CustomHandler(IExternalEventHandler):
    def Execute(self, application):
        try:
            customizable_event.raised_method()
        except InvalidOperationException:
            # If you don't catch this exeption Revit may crash.
            print("InvalidOperationException catched")

    # noinspection PyMethodMayBeStatic, PyPep8Naming
    def GetName(self):
        return "Execute an function or method in a IExternalHandler"


# Create an handler instance and his associated ExternalEvent
custom_handler = CustomHandler()
custom_event = ExternalEvent.Create(custom_handler)



label1 = Label();
button1 = Button();
button2 = Button();

button4 = Button();

# A simple WPF form used to call the ExternalEvent
class ModelessForm(Form):
	"""
	Simple modeless form sample
	"""
	def __init__(self):
		self.Text = 'Place Beam Tags'
		self.elementsIds = []
		self.originalMarks = []
		self.values = []
		self.Show()
	
	def addElements(self, items):
		for i in items:
			self.elementsIds.append(i)

	def acceptChanges(self, sender, e):
		if len(self.elementsIds) > 0:
			CustomizableEvent.raise_event(customizable_event, AcceptChanges, self.elementsIds, newTagsList) 
			self.Close()
		else:
			TaskDialog.Show("Warning", "No beams have been selected")
	
	def undoChanges(self, sender, e):
		CustomizableEvent.raise_event(customizable_event, DiscardChanges, self.elementsIds, self.originalMarks)
		self.Close()
		
	def PlaceTags(self, sender, e):
		CustomizableEvent.raise_event(customizable_event, TagAndOverride, newTagsList)
		
		
		
# Let's launch our beautiful and useful form !
form = ModelessForm()
form.TopMost = True


form.TopMost = True
form.Height = 150
form.Width = 380
form.StartPosition = FormStartPosition.CenterScreen


label1.Location = dPoint(12, 75);
label1.Name = "label1";
label1.Size = dSize(300, 63);
label1.TabIndex = 2;
label1.Text = "You are updating the beam tags. Click Apply Changes to update the beam Mark values.";
label1.UseCompatibleTextRendering = True;


button1.Location = dPoint(10, 20);
button1.Name = "button1";
button1.Size = dSize(88, 32);
button1.TabIndex = 0;
button1.Text = "New Tags";
button1.UseCompatibleTextRendering = True;
button1.UseVisualStyleBackColor = True;
button1.Click += EventHandler(form.PlaceTags);


button2.Location = dPoint(250, 20);
button2.Name = "Cancel";
button2.Size = dSize(88, 32);
button2.TabIndex = 1;
button2.Text = "Undo Changes";
button2.UseCompatibleTextRendering = True;
button2.UseVisualStyleBackColor = True;
button2.Click += EventHandler(form.undoChanges);


button4.Location = dPoint(125, 20);
button4.Name = "OK";
button4.Size = dSize(100, 32);
button4.TabIndex = 1;
button4.Text = "Apply Changes";
button4.UseCompatibleTextRendering = True;
button4.UseVisualStyleBackColor = True;
button4.Click += EventHandler(form.acceptChanges);



form.Controls.Add(button1);
form.Controls.Add(button2);

form.Controls.Add(button4);
form.Controls.Add(label1);

#result = form.values



OUT = form.elementsIds
# ----------------------------------------
code_block_2 = CodeBlock { 1; }
python_script_2 = Python()  # frozen; unwired: IN[0]
# ---------- python_script_2.python (56 lines) ----------
import clr

clr.AddReference("System.Windows.Forms")
from System.Windows.Forms import Application, Button, Form, Label, TextBox, CheckBox, FolderBrowserDialog, OpenFileDialog, DialogResult, ComboBox, FormBorderStyle, FormStartPosition

clr.AddReference("System.Drawing")
from System.Drawing import Point as dPoint
from System.Drawing import Size as dSize


clr.AddReference("System")
from System import EventHandler


clr.AddReference("RevitAPIUI")
from Autodesk.Revit.UI import IExternalEventHandler, ExternalEvent, TaskDialog

clr.AddReference("RevitAPI")
from Autodesk.Revit.DB import Transaction, OverrideGraphicSettings, ElementId, Color
# noinspection PyUnresolvedReferences
from Autodesk.Revit.Exceptions import InvalidOperationException


clr.AddReference('RevitServices')
from RevitServices.Persistence import DocumentManager


global result
doc = DocumentManager.Instance.CurrentDBDocument
uidoc = DocumentManager.Instance.CurrentUIApplication.ActiveUIDocument

def ResetOverrideColor(elements):
	view = doc.ActiveView
	booleans = []
	override = OverrideGraphicSettings()
	t = Transaction(doc, "Undo")
	t.Start()
	for item in elements:
		view.SetElementOverrides(item, override)
		booleans.append(True)
	t.Commit()
	#TaskDialog.Show("result", str(len(elements)))
	return booleans
	
elements = uidoc.Selection.GetElementIds()

form = []

for i in elements:
	form.append(i)





OUT = elements, form, ResetOverrideColor(form)
# ----------------------------------------
select_model_elements = DSModelElementsSelection()  # 2 picked in the model
