# Dynamo graph DL_PIPE_CONNECTIONS_UI_1.0.dyn (Dynamo 1.3.2.2480)

# group: Select Detail Lines
select_model_elements = DSModelElementsSelection()  # 6 picked in the model

code_block = CodeBlock { {0,1000}; }

# group: Adds Z Axis
code_block_2 = CodeBlock { 0; }
watch = Watch(select_model_elements)
code_block_3 = CodeBlock { "Line Style"; }
getParameterValueByName = Element.GetParameterValueByName(element=watch, parameterName=code_block_3)
name = Parameter.Name(getParameterValueByName)
uniqueItems = List.UniqueItems(name)
allIndicesOf = List.AllIndicesOf(list=name, item=uniqueItems)
getItemAtIndex = List.GetItemAtIndex(list=watch, index=allIndicesOf)
watch_2 = Watch(getItemAtIndex)
curves = Element.Curves(watch_2)
flatten = Flatten(curves@L3)
watch_3 = Watch(flatten)
ZAxis = Vector.ZAxis()
translate = Geometry.Translate(geometry=watch_3, direction=ZAxis, distance=code_block)

# group: SPLIT EACH LINE USING ONLY THE POINTS THAT BELONG TO THAT LINE
flatten_2 = Flatten(translate)
intersectAll = Curve.IntersectAll(flatten_2)
doesIntersect = Geometry.DoesIntersect(geometry=flatten_2, other=intersectAll, lacing=CrossProduct)
filterByBoolMask = List.FilterByBoolMask(list=intersectAll@@L2, mask=doesIntersect, lacing=Longest)
splitByPoints = Curve.SplitByPoints(curve=flatten_2, points=filterByBoolMask.in)

flatten_3 = Flatten(splitByPoints)
watch_4 = Watch(flatten_3)
watch_5 = Watch(select_model_elements)
count = Count(splitByPoints@L2)
cycle = List.Cycle(list=watch_5, amount=count, lacing=Longest)
watch_6 = Watch(cycle)

# group: DataShapes UI Inputs
categories = Categories("PipeCurves")
all_elements_of_category = ElementsOfCategory(categories)
code_block_4 = CodeBlock { "Type"; }
getParameterValueByName_2 = Element.GetParameterValueByName(element=all_elements_of_category, parameterName=code_block_4)
uniqueItems_2 = List.UniqueItems(getParameterValueByName_2)
name_2 = Parameter.Name(uniqueItems_2)
code_block_5 = CodeBlock { "Line Style"; }
getParameterValueByName_3 = Element.GetParameterValueByName(element=watch_6, parameterName=code_block_5)
watch_7 = Watch(getParameterValueByName_3)
categories_2 = Categories("PipingSystem")
all_elements_of_category_2 = ElementsOfCategory(categories_2)
code_block_6 = CodeBlock { "Type"; }
getParameterValueByName_4 = Element.GetParameterValueByName(element=all_elements_of_category_2, parameterName=code_block_6)
uniqueItems_3 = List.UniqueItems(getParameterValueByName_4)
watch_8 = Watch(uniqueItems_3)
code_block_7 = CodeBlock { "Type Name"; }
getParameterValueByName_5 = Element.GetParameterValueByName(element=watch_8, parameterName=code_block_7)
uniqueItems_4 = List.UniqueItems(getParameterValueByName_5)

removeNulls = Lists.Manage.RemoveNulls(name_2)
flatten_4 = Flatten(watch_7)

# group (continued): DataShapes UI Inputs
uniqueItems_5 = List.UniqueItems(flatten_4)
name_3 = Parameter.Name(uniqueItems_5)
watch_9 = Watch(name_3)

# group: Creates UI
watch_10 = Watch(removeNulls)
flatten_5 = Flatten(watch_9)
ui_dropdown_data = Custom[UI.DropDown Data](InputName=flatten_5, Keys=uniqueItems_4, Values=uniqueItems_4)  # Create data for DropDown input in UI.MultiInputForm ++ . Check out www.data-shapes.net for more infos.
ui_dropdown_data_2 = Custom[UI.DropDown Data](InputName=flatten_5, Keys=name_2, Values=name_2)
create = List.Create(ui_dropdown_data, ui_dropdown_data_2)
flatten_6 = Flatten(create)
boolean = BoolSelector(true)
ui_multipleinputform = Custom[UI.MultipleInputForm ++](Inputs=flatten_6, Toggle=boolean)  # Create a form with multiple inputs. see www.data-shapes.net for tutorials and infos!
watch_11 = Watch(ui_multipleinputform.User_Inputs)
allIndicesOf_2 = List.AllIndicesOf(list=watch_10, item=watch_11)
getItemAtIndex_2 = List.GetItemAtIndex(list=getParameterValueByName_2, index=allIndicesOf_2@L1)
code_block_8 = CodeBlock(PipeTypeList=getItemAtIndex_2) { Flatten(PipeTypeList); }
code_block_9 = CodeBlock { "Line Style"; }
getParameterValueByName_6 = Element.GetParameterValueByName(element=select_model_elements, parameterName=code_block_9)
name_4 = Element.Name(getParameterValueByName_6)
allIndicesOf_3 = List.AllIndicesOf(list=watch_9, item=name_4)
getItemAtIndex_3 = List.GetItemAtIndex(list=code_block_8, index=allIndicesOf_3@L1)
watch_12 = Watch(getItemAtIndex_3)
allIndicesOf_4 = List.AllIndicesOf(list=uniqueItems_4, item=ui_multipleinputform.User_Inputs)
getItemAtIndex_4 = List.GetItemAtIndex(list=watch_8, index=allIndicesOf_4@L1)
code_block_10 = CodeBlock(SystemTypeList=getItemAtIndex_4) { Flatten(SystemTypeList); }
getItemAtIndex_5 = List.GetItemAtIndex(list=code_block_10, index=allIndicesOf_3@L1)
watch_13 = Watch(getItemAtIndex_5)

# group: Creates the Pipes
watch_14 = Watch(watch_4)
code_block_11 = CodeBlock(Lines=watch_14) { Lines; }
levels = Levels("00")
diameter_of_pipe = CodeBlock { 16; }
byLines = Custom[Pipe.ByLines](Lines=code_block_11, PipeType=watch_12, SystemType=watch_13, Level=levels, Diameter=diameter_of_pipe, lacing=Longest)  # Creates a pipe by Line, PipeType, SystemType, Level and Diameter

# group: Geometry Test - Counts how pipes share the same start/end point
tolerance_of_fittings = CodeBlock { 10; }
byCenterPointRadius = Sphere.ByCenterPointRadius(centerPoint=intersectAll, radius=tolerance_of_fittings)
flatten_7 = Flatten(byCenterPointRadius)
count_2 = Count(flatten_7)
ofRepeatedItem = List.OfRepeatedItem(item=byLines, amount=count_2)
location = Custom[Element.Location](element=byLines)  # Returns the location of an element as an XYZ (or if it's line-based the start and end point of the line), along with some booleans to help filtering the results. Use this for some element types (e.g. walls or lines) that do not work with the built-in Get Family Instance Location node.
doesIntersect_2 = Geometry.DoesIntersect(geometry=flatten_7, other=location.curves, lacing=CrossProduct)
filterByBoolMask_2 = List.FilterByBoolMask(list=ofRepeatedItem, mask=doesIntersect_2)

sorted_pipes = Watch(filterByBoolMask_2.in)

# group: Counts how pipes for each fitting (2 = Elbow, 3 = Tee, 4 = Cross
count_3 = List.Count(sorted_pipes, lacing=Longest)
watch_15 = Watch(count_3)

# group: Filters Crosses
code_block_12 = CodeBlock { 4; }
eq = watch_15 == code_block_12
filterByBoolMask_3 = List.FilterByBoolMask(list=sorted_pipes, mask=eq)
watch_16 = Watch(filterByBoolMask_3.in)

# group: Controls Spilt Amount
count_4 = Count(sorted_pipes)
code_block_13 = CodeBlock(a=count_4) { a*4; }

# group: Crosses
flatten_8 = Flatten(watch_16)
code_block_14 = CodeBlock(a=code_block_13) { 0..a..4; 1..a..4; 2..a..4; 3..a..4; }
getItemAtIndex_6 = List.GetItemAtIndex(list=flatten_8, index=code_block_14.out0)
removeNulls_2 = Lists.Manage.RemoveNulls(getItemAtIndex_6)
watch_17 = Watch(removeNulls_2)
getItemAtIndex_7 = List.GetItemAtIndex(list=flatten_8, index=code_block_14.out1)
removeNulls_3 = Lists.Manage.RemoveNulls(getItemAtIndex_7)
watch_18 = Watch(removeNulls_3)
getItemAtIndex_8 = List.GetItemAtIndex(list=flatten_8, index=code_block_14.out2)
removeNulls_4 = Lists.Manage.RemoveNulls(getItemAtIndex_8)
watch_19 = Watch(removeNulls_4)
getItemAtIndex_9 = List.GetItemAtIndex(list=flatten_8, index=code_block_14.out3)
removeNulls_5 = Lists.Manage.RemoveNulls(getItemAtIndex_9)
watch_20 = Watch(removeNulls_5)
python_script = Python(IN[0]=watch_17, IN[1]=watch_18, IN[2]=watch_19, IN[3]=watch_20)
# ---------- python_script.python (79 lines) ----------
import clr

clr.AddReference("RevitServices")
import RevitServices
from RevitServices.Persistence import DocumentManager
from RevitServices.Transactions import TransactionManager
doc = DocumentManager.Instance.CurrentDBDocument

clr.AddReference("RevitAPI")
from Autodesk.Revit.DB import *

clr.AddReference("RevitNodes")
import Revit
clr.ImportExtensions(Revit.Elements)
clr.ImportExtensions(Revit.GeometryConversion)

if isinstance(IN[0], list):
	pipe1 = UnwrapElement(IN[0])
else:
	pipe1 = [UnwrapElement(IN[0])]
if isinstance(IN[1], list):
	pipe2 = UnwrapElement(IN[1])
else:
	pipe2 = [UnwrapElement(IN[1])]
if isinstance(IN[2], list):
	pipe3 = UnwrapElement(IN[2])
else:
	pipe3 = [UnwrapElement(IN[2])]
if isinstance(IN[3], list):
	pipe4 = UnwrapElement(IN[3])
else:
	pipe4 = [UnwrapElement(IN[3])]

def closest_connectors(pipe1, pipe2,pipe3, pipe4):
	conn1 = pipe1.ConnectorManager.Connectors
	conn2 = pipe2.ConnectorManager.Connectors
	conn3 = pipe3.ConnectorManager.Connectors
	conn4 = pipe4.ConnectorManager.Connectors
	
	dist1 = 100000000
	dist2 = 100000000
	dist3 = 100000000
	connset = []
	for c in conn1:
		for d in conn2:
			conndist = c.Origin.DistanceTo(d.Origin)
			if conndist < dist1:
				dist1 = conndist
				c1 = c
				d1 = d
		for e in conn3:
			conndist = c.Origin.DistanceTo(e.Origin)
			if conndist < dist2:
				dist2 = conndist
				e1 = e
		for f in conn4:
			conndist = c.Origin.DistanceTo(f.Origin)
			if conndist < dist3:
				dist3 = conndist
				f1 = f
		connset = [c1,d1,e1,f1]
	return connset

	
fittings = []
TransactionManager.Instance.EnsureInTransaction(doc)
for p1,p2,p3,p4 in zip(pipe1,pipe2,pipe3,pipe4):
	connectors = closest_connectors(p1,p2,p3,p4)
	try:
		fitting = doc.Create.NewCrossFitting(connectors[0],connectors[1],connectors[2],connectors[3])
		fittings.append(fitting.ToDSType(False))
	except:
		fittings.append(None)
		
TransactionManager.Instance.TransactionTaskDone()

			

OUT = fittings
# ----------------------------------------
watch_21 = Watch(python_script)

# group: Filter Elbows
code_block_15 = CodeBlock { 2; }
eq_2 = watch_15 == code_block_15
filterByBoolMask_4 = List.FilterByBoolMask(list=sorted_pipes, mask=eq_2)
watch_22 = Watch(filterByBoolMask_4.in)

# group: Elbow
flatten_9 = Flatten(watch_22)
code_block_16 = CodeBlock { 2; }
byMEPCurves = Custom[Elbow.ByMEPCurves](MEPCurves=flatten_9, Margin=code_block_16)  # Takes in a list of MEPCurves (pipe, duct, cable tray, conduit) and will attempt to create elbows where possible. A margin can be entered for max distance between connectors
watch_23 = Watch(byMEPCurves)

# group: Filter Tee
code_block_17 = CodeBlock { 3; }
eq_3 = watch_15 == code_block_17
filterByBoolMask_5 = List.FilterByBoolMask(list=sorted_pipes, mask=eq_3)
watch_24 = Watch(filterByBoolMask_5.in)

# group: Tee
flatten_10 = Flatten(watch_24)
code_block_18 = CodeBlock(a=code_block_13) { 0..a..3; 1..a..3; 2..a..3; }
getItemAtIndex_10 = List.GetItemAtIndex(list=flatten_10, index=code_block_18.out2)
watch_25 = Watch(getItemAtIndex_10)
watch_26 = Watch(code_block_18.out2)
getItemAtIndex_11 = List.GetItemAtIndex(list=flatten_10, index=code_block_18.out1)
removeNulls_6 = Lists.Manage.RemoveNulls(getItemAtIndex_11)
flatten_11 = Flatten(removeNulls_6)
watch_27 = Watch(flatten_11)
removeNulls_7 = Lists.Manage.RemoveNulls(getItemAtIndex_10)
flatten_12 = Flatten(removeNulls_7)
watch_28 = Watch(flatten_12)
getItemAtIndex_12 = List.GetItemAtIndex(list=flatten_10, index=code_block_18.out0)
removeNulls_8 = Lists.Manage.RemoveNulls(getItemAtIndex_12)
flatten_13 = Flatten(removeNulls_8)
watch_29 = Watch(flatten_13)
by3MEPCurves = Custom[Tee.By3MEPCurves](Main_MEPCurve=watch_27, Main_MEPCurve_2=watch_28, Branch_MEPCurve=watch_29)  # Creates a new Tee fitting for the 3 input MEP curves (conduit, cable tray, duct or pipe). Only works with a perpendicular branch MEPCurve
watch_30 = Watch(by3MEPCurves)

watch_31 = Watch(translate)
code_block_19 = CodeBlock { 0; 500; 1000; 1500; 2000; 2500; 3000; 3500; 4000; }
create_2 = List.Create(code_block_19.out0, code_block_19.out1, code_block_19.out2, code_block_19.out3, code_block_19.out4, code_block_19.out5, code_block_19.out6, code_block_19.out7, code_block_19.out8)

# group: 2nd Tee Test
code_block_20 = CodeBlock { "Failed"; }
replaceNulls = Lists.Manage.ReplaceNulls(watch_30, code_block_20)
allIndicesOf_5 = List.AllIndicesOf(list=replaceNulls, item=code_block_20)
getItemAtIndex_13 = List.GetItemAtIndex(list=watch_27, index=allIndicesOf_5)
getItemAtIndex_14 = List.GetItemAtIndex(list=watch_29, index=allIndicesOf_5)
getItemAtIndex_15 = List.GetItemAtIndex(list=watch_28, index=allIndicesOf_5)
by3MEPCurves_2 = Custom[Tee.By3MEPCurves](Main_MEPCurve=getItemAtIndex_13, Main_MEPCurve_2=getItemAtIndex_14, Branch_MEPCurve=getItemAtIndex_15)

# group: 3rd Tee Test
replaceNulls_2 = Lists.Manage.ReplaceNulls(by3MEPCurves_2, code_block_20)
allIndicesOf_6 = List.AllIndicesOf(list=replaceNulls_2, item=code_block_20)
getItemAtIndex_16 = List.GetItemAtIndex(list=getItemAtIndex_13, index=allIndicesOf_6)
getItemAtIndex_17 = List.GetItemAtIndex(list=getItemAtIndex_14, index=allIndicesOf_6)
getItemAtIndex_18 = List.GetItemAtIndex(list=getItemAtIndex_15, index=allIndicesOf_6)
by3MEPCurves_3 = Custom[Tee.By3MEPCurves](Main_MEPCurve=getItemAtIndex_16, Main_MEPCurve_2=getItemAtIndex_17, Branch_MEPCurve=getItemAtIndex_18)
