# Dynamo graph DesignCheck_CastInPlate_DynamoScript.dyn (Dynamo 1.3.2.2480)

# group: CiP Family Type
family_types = FamilyTypes("Cast in Plate  - Type Family:2x2 Studs, 2xB16 Anchors")

# group: Select All Beams
categories = Categories("StructuralFraming")
all_elements_of_category = ElementsOfCategory(categories)

# group: Establish Where Cast-In Plates Required
code_block = CodeBlock { "Connection_End 1_Type"; "Connection_End 2_Type"; }
getParameterValueByName = Element.GetParameterValueByName(element=all_elements_of_category, parameterName=code_block.out0)
code_block_2 = CodeBlock(list=getParameterValueByName) { list; }
code_block_3 = CodeBlock(item=code_block_2) { Flatten({item}); }
string_from_object = FromObject()  # unwired: arg0
code_block_4 = CodeBlock { "CiP"; }
code_block_5 = CodeBlock(x=code_block_4) { x:string; }
boolean = BoolSelector(true)
contains = String.Contains(searchFor=code_block_5, ignoreCase=boolean)  # unwired: str
compose = ComposeFunctions(string_from_object, contains)  # "Function.Compose"
map = List.Map(list=code_block_3, f_x=compose)
code_block_6 = CodeBlock(Bool=map) { Bool; }
filterByBoolMask = List.FilterByBoolMask(list=all_elements_of_category, mask=code_block_6)
getParameterValueByName_2 = Element.GetParameterValueByName(element=all_elements_of_category, parameterName=code_block.out1)
code_block_7 = CodeBlock(list=getParameterValueByName_2) { list; }
code_block_8 = CodeBlock(item=code_block_7) { Flatten({item}); }
string_from_object_2 = FromObject()  # unwired: arg0
code_block_9 = CodeBlock(x=code_block_4) { x:string; }
boolean_2 = BoolSelector(true)
contains_2 = String.Contains(searchFor=code_block_9, ignoreCase=boolean_2)  # unwired: str
compose_2 = ComposeFunctions(string_from_object_2, contains_2)  # "Function.Compose"
map_2 = List.Map(list=code_block_8, f_x=compose_2)
code_block_10 = CodeBlock(Bool=map_2) { Bool; }
filterByBoolMask_2 = List.FilterByBoolMask(list=all_elements_of_category, mask=code_block_10)

# group: Coordinates of Cast-In Plates at End 1
python_script = Python(IN[0]=filterByBoolMask.in)
# ---------- python_script.python (94 lines) ----------
import clr
import math
clr.AddReference('RevitAPI')
from Autodesk.Revit.DB import *

clr.AddReference("RevitNodes")
import Revit
clr.ImportExtensions(Revit.GeometryConversion)

items = UnwrapElement(IN[0])
pointlist, curvepointlist, ispoint, iscurve, curves, haslocation, angles, hasrotation = [], [], [], [], [], [], [], []

for item in items:
	try:
		# points and text notes
		pointlist.append(item.Coord.ToPoint())
		ispoint.append(True)
		iscurve.append(False)
		haslocation.append(True)
		hasrotation.append(False)
	except:
		try:
			loc = item.Location
			if loc.ToString() == 'Autodesk.Revit.DB.LocationCurve':
				# line-based elements (e.g. walls)
				curvepoints = (loc.Curve.GetEndPoint(0).ToPoint(),loc.Curve.GetEndPoint(1).ToPoint())
				curvepointlist.append(curvepoints)
				curves.append(loc.Curve.ToProtoType())
				ispoint.append(False)
				iscurve.append(True)
				haslocation.append(True)
				hasrotation.append(False)
			elif loc.ToString() == 'Autodesk.Revit.DB.LocationPoint':
				# point-based elements
				pointlist.append(loc.Point.ToPoint())
				ispoint.append(True)
				iscurve.append(False)
				haslocation.append(True)
				try:
					angles.append(math.degrees(loc.Rotation))
					hasrotation.append(True)
				except:
					hasrotation.append(False)
			else:
				# check for host objects outlines (floor slabs etc.)
				try:
					refs = HostObjectUtils.GetTopFaces(item)
					blines = []
					bpoints = []
					for ref in refs:
						try:
							boundaries = item.GetGeometryObjectFromReference(ref).GetEdgesAsCurveLoops()
							for loop in boundaries:
								cloop = []
								clooppoints = []
								for line in loop:
									cloop.append(line.ToProtoType())
									curvepoint = (line.GetEndPoint(0).ToPoint(),line.GetEndPoint(1).ToPoint())
									clooppoints.append(curvepoint)
								blines.append(cloop)
								bpoints.append(clooppoints)
						except:
							pass
					if (len(blines) > 0):
						curves.append(blines)
						curvepointlist.append(bpoints)
						iscurve.append(True)
						haslocation.append(True)
					else:
						iscurve.append(False)
						haslocation.append(False)
					ispoint.append(False)
					hasrotation.append(False)
				except:
					ispoint.append(False)
					iscurve.append(False)
					haslocation.append(False)
					hasrotation.append(False)
		except:
			try:
				# curves
				curvepoints = (item.GetEndPoint(0).ToPoint(),item.GetEndPoint(1).ToPoint())
				curvepointlist.append(curvepoints)
				curves.append(item.ToProtoType())
				ispoint.append(False)
				iscurve.append(True)
				haslocation.append(True)
				hasrotation.append(False)
			except:
				ispoint.append(False)
				iscurve.append(False)
				haslocation.append(False)
				hasrotation.append(False)
OUT = (pointlist,curvepointlist,curves,ispoint,iscurve,haslocation,angles,hasrotation)
# ----------------------------------------
code_block_11 = CodeBlock(seq=python_script) { seq[0]; seq[1]; seq[2]; seq[3]; seq[4]; seq[5]; seq[6]; seq[7]; }
code_block_12 = CodeBlock(curveEndpoints=code_block_11.out1) { curveEndpoints; }
watch = Watch(code_block_12)

# group: Place Cast-In Plates at End 1
code_block_13 = CodeBlock(list=code_block_12) { list; }
code_block_14 = CodeBlock(item=code_block_13) { Flatten({item}); }
string_from_object_3 = FromObject()  # unwired: arg0
code_block_15 = CodeBlock { "Point"; 2; 1; }
code_block_16 = CodeBlock(x=code_block_15.out0) { x:string; }
boolean_3 = BoolSelector(true)
contains_3 = String.Contains(searchFor=code_block_16, ignoreCase=boolean_3)  # unwired: str
compose_3 = ComposeFunctions(string_from_object_3, contains_3)  # "Function.Compose"
filter = List.Filter(code_block_14, compose_3)
code_block_17 = CodeBlock(Match=filter) { Match; }
dropEveryNthItem = List.DropEveryNthItem(list=code_block_17, n=code_block_15.out1)
translate = Geometry.Translate(geometry=dropEveryNthItem)
Z = Point.Z(translate)
dropEveryNthItem_2 = List.DropEveryNthItem(list=code_block_17, n=code_block_15.out1, offset=code_block_15.out2)
translate_2 = Geometry.Translate(geometry=dropEveryNthItem_2)
X = Point.X(translate_2)
Y = Point.Y(translate_2)

# group: Identify Where Cast-In Plates End 1 Hit RC Walls
categories_2 = Categories("Walls")
all_elements_of_category_2 = ElementsOfCategory(categories_2)
faces = Element.Faces(all_elements_of_category_2)
byJoinedSurfaces = PolySurface.ByJoinedSurfaces(faces)
boundingBox = Geometry.BoundingBox(byJoinedSurfaces)
contains_4 = BoundingBox.Contains(boundingBox, translate@L1)
code_block_18 = CodeBlock { true; }
eq = contains_4 == code_block_18
code_block_19 = CodeBlock { ""; }
if_ = If(test=eq, true=all_elements_of_category_2, false=code_block_19)
code_block_20 = CodeBlock { ""; false; true; }
eq_2 = if_ == code_block_20.out0
if_2 = If(test=eq_2, true=code_block_20.out1, false=code_block_20.out2)
filterByBoolMask_3 = List.FilterByBoolMask(list=if_, mask=if_2)

# group: Find main wall surface
area = Surface.Area(faces)
ceiling = Math.Ceiling(area)
maximumItem = List.MaximumItem(area)
ceiling_2 = Math.Ceiling(maximumItem)
indexOf = IndexOf(ceiling, ceiling_2, lacing=Longest)
code_block_21 = CodeBlock { 1; }
chop = List.Chop(list=indexOf, lengths=code_block_21)

# group: Rotate Cast-In Plates End 1
filterByBoolMask_4 = List.FilterByBoolMask(list=faces, mask=if_2@L2)
getItemAtIndex = List.GetItemAtIndex(list=filterByBoolMask_4.in@L2, index=chop@L2)
flatten = Flatten(getItemAtIndex)
code_block_22 = CodeBlock { 0; 0.5; 0.5; }
normalAtParameter = Surface.NormalAtParameter(surface=flatten, u=code_block_22.out1, v=code_block_22.out2, lacing=Longest)
X_2 = Vector.X(normalAtParameter)
code_block_23 = CodeBlock { 0; }
lt = X_2 < code_block_23
if_3 = If(test=lt, true=code_block_23, false=X_2)
code_block_24 = CodeBlock { 1; }
add = chop + code_block_24
getItemAtIndex_2 = List.GetItemAtIndex(list=filterByBoolMask_4.in@L2, index=add@L2)
flatten_2 = Flatten(getItemAtIndex_2)
normalAtParameter_2 = Surface.NormalAtParameter(surface=flatten_2, u=code_block_22.out1, v=code_block_22.out2, lacing=Longest)
X_3 = Vector.X(normalAtParameter_2)
lt_2 = X_3 < code_block_23
if_4 = If(test=lt_2, true=code_block_23, false=X_3)
add_2 = if_3 + if_4
Y_2 = Vector.Y(normalAtParameter)
if_5 = If(test=lt, true=code_block_23, false=Y_2)
Y_3 = Vector.Y(normalAtParameter_2)
if_6 = If(test=lt_2, true=code_block_23, false=Y_3)
add_3 = if_5 + if_6
code_block_25 = CodeBlock { 0; }
byCoordinates = Vector.ByCoordinates(x=add_2, y=add_3, z=code_block_25)
XAxis = Vector.XAxis()
angleWithVector = Vector.AngleWithVector(vector=byCoordinates, otherVector=XAxis)
Y_4 = Vector.Y(byCoordinates)
lt_3 = Y_4 < code_block_23
code_block_26 = CodeBlock { -1; 1; 180; 0; }
if_7 = If(test=lt_3, true=code_block_26.out0, false=code_block_26.out1)
mul = angleWithVector * if_7
if_8 = If(test=lt_3, true=code_block_26.out2, false=code_block_26.out3)
add_4 = mul + if_8

# group: Wall Parameters
python_script_2 = Python()  # unwired: IN[0]
# ---------- python_script_2.python (14 lines) ----------
import clr
clr.AddReference('ProtoGeometry')
from Autodesk.DesignScript.Geometry import *
#The inputs to this node will be stored as a list in the IN variables.
dataEnteringNode = IN

#Assign your output to the OUT variable.
OUT = ["Specification_Material_Strength Grade",
	"Type",
	"Reinforcement_Bars_Diameter_FF1",
	"Reinforcement_Bars_Diameter_FF2",
	"Reinforcement_Bars_Spacing_FF1",
	"Reinforcement_Bars_Spacing_FF2",
	"Reinforcement_Cover_Far Face"]
# ----------------------------------------
code_block_27 = CodeBlock(seq=python_script_2) { seq[0]; seq[1]; seq[2]; seq[3]; seq[4]; seq[5]; seq[6]; }
watch_2 = Watch(python_script_2)

# group: Wall Properties at End 1 Cast-In Plates
getParameterValueByName_3 = Element.GetParameterValueByName(element=filterByBoolMask_3.in, parameterName=code_block_27.out1)
string_from_object_4 = FromObject(getParameterValueByName_3)
code_block_28 = CodeBlock { "Thickness"; 1; }
split = String.Split(string_from_object_4, code_block_28.out0)
getItemAtIndex_3 = List.GetItemAtIndex(list=split@L2, index=code_block_28.out1)
toNumber = String.ToNumber(getItemAtIndex_3)
code_block_29 = CodeBlock(t=toNumber) { t/2; }
getParameterValueByName_4 = Element.GetParameterValueByName(element=filterByBoolMask_3.in, parameterName=code_block_27.out0)
flatten_3 = Flatten(getParameterValueByName_4)
toNumber_2 = String.ToNumber(flatten_3)
getParameterValueByName_5 = Element.GetParameterValueByName(element=filterByBoolMask_3.in, parameterName=code_block_27.out2)
code_block_30 = CodeBlock(x=getParameterValueByName_5) { x; x*25.4*12; }
flatten_4 = Flatten(code_block_30.out1)
getParameterValueByName_6 = Element.GetParameterValueByName(element=filterByBoolMask_3.in, parameterName=code_block_27.out3)
code_block_31 = CodeBlock(x=getParameterValueByName_6) { x; x*25.4*12; }
flatten_5 = Flatten(code_block_31.out1)
getParameterValueByName_7 = Element.GetParameterValueByName(element=filterByBoolMask_3.in, parameterName=code_block_27.out6)
code_block_32 = CodeBlock(x=getParameterValueByName_7) { x; x*25.4*12; }
flatten_6 = Flatten(code_block_32.out1)
code_block_33 = CodeBlock(t=toNumber, bar_dia_y=flatten_4, bar_dia_z=flatten_5, cover=flatten_6) { t; bar_dia_y; bar_dia_z; cover; d_y = t - cover - (bar_dia_y/2); d_z = t - cover - bar_dia_y - (bar_dia_z/2); }
getParameterValueByName_8 = Element.GetParameterValueByName(element=filterByBoolMask_3.in, parameterName=code_block_27.out4)
code_block_34 = CodeBlock(x=getParameterValueByName_8) { x; x*25.4*12; }
flatten_7 = Flatten(code_block_34.out1)
code_block_35 = CodeBlock(t=toNumber, bar_dia=flatten_4, bar_spc=flatten_7) { t; bar_dia; bar_spc; rho_y = (bar_dia*3.14*1000/bar_spc)/(t*1000); }
getParameterValueByName_9 = Element.GetParameterValueByName(element=filterByBoolMask_3.in, parameterName=code_block_27.out5)
code_block_36 = CodeBlock(x=getParameterValueByName_9) { x; x*25.4*12; }
flatten_8 = Flatten(code_block_36.out1)
code_block_37 = CodeBlock(t=toNumber, bar_dia=flatten_5, bar_spc=flatten_8) { t; bar_dia; bar_spc; rho_z = (bar_dia*3.14*1000/bar_spc)/(t*1000); }

# group (continued): Place Cast-In Plates at End 1
translate_3 = Geometry.Translate(geometry=translate, direction=byCoordinates, distance=code_block_29)
X_4 = Point.X(translate_3)
Y_5 = Point.Y(translate_3)
byCoordinates_2 = FamilyInstance.ByCoordinates(family_types, X_4, Y_5, Z)
setRotation = FamilyInstance.SetRotation(familyInstance=byCoordinates_2, degree=add_4)
code_block_38 = CodeBlock(x1=X_4, x2=X, y1=Y_5, y2=Y) { x1; x2; y1; y2; (x2-x1)/(y2-y1); }
atan = Math.Atan(code_block_38.out4)
add_5 = angleWithVector + atan

# group: Get Beam End Reactions
code_block_39 = CodeBlock { "Connection_End 1_Shear_Vz Major"; "Connection_End 2_Shear_Vz Major"; }
getParameterValueByName_10 = Element.GetParameterValueByName(element=filterByBoolMask.in, parameterName=code_block_39.out0)
getParameterValueByName_11 = Element.GetParameterValueByName(element=filterByBoolMask_2.in, parameterName=code_block_39.out1)
code_block_40 = CodeBlock(a=getParameterValueByName_10, c=getParameterValueByName_11) { a; b=3280.839895; c; a/b; c/b; }

# group: Beam Reactions End 1
watch_3 = Watch(code_block_40.out3)

# group: Cast-In Plate Family Parameters
python_script_3 = Python()  # unwired: IN[0]
# ---------- python_script_3.python (34 lines) ----------
import clr
clr.AddReference('ProtoGeometry')
from Autodesk.DesignScript.Geometry import *

#Assign your output to the OUT variable.

OUT = ["Cast-In Plate Yield Stress",
	"Cast-In Plate Width",
	"Cast In Plate Height",
	"Cast-In Plate Thickness",
	"Rows of Shear Studs",
	"Stud & Anchor X Edge Distance",
	"Stud & Anchor Y Edge Distance",
	"Shear Stud Ultimate Tensile Strength",
	"Shear Stud Diameter",
	"Shear Stud Height",
	"Rebar Anchor Diameter",
	"Rebar Anchor Yield Stress",
	"Rebar Anchor Vertical Length",
	"Rebar Anchor Mandrel Diameter",
	"Cross-Bar Phi",
	"Minimum Fin Plate Depth",
	"Fin Plate Thickness",
	"Fin Plate Weld Leg Length",
	"Fin Plate Yield Stress",
	"Plan Position of Concrete Tolerance",
	"Centroid of Bolt Group to End of Beam Distance",
	"Cast-In Plate Setback From Face of Wall",
	"Fin Plate Position Tolerance",
	"Minimum Gap Between Wall and Beam",
	"Maximum Vertical Misalignment of Cast-In Plate",
	"Maximum Horizontal Misalignment of Cast-In Plate",
	"Rebar Anchor Horizontal Length",
	"Top of Fin Plate From Top of Cast-In Plate"]
# ----------------------------------------
code_block_41 = CodeBlock(seq=python_script_3)
# ---------- code_block_41.designscript (28 lines) ----------
seq[0];
seq[1];
seq[2];
seq[3];
seq[4];
seq[5];
seq[6];
seq[7];
seq[8];
seq[9];
seq[10];
seq[11];
seq[12];
seq[13];
seq[14];
seq[15];
seq[16];
seq[17];
seq[18];
seq[19];
seq[20];
seq[21];
seq[22];
seq[23];
seq[24];
seq[25];
seq[26];
seq[27];
# ----------------------------------------
watch_4 = Watch(python_script_3)

# group: CiP Parameters
getParameterValueByName_12 = Element.GetParameterValueByName(element=family_types, parameterName=code_block_41.out0)
getParameterValueByName_13 = Element.GetParameterValueByName(element=family_types, parameterName=code_block_41.out1)
getParameterValueByName_14 = Element.GetParameterValueByName(element=family_types, parameterName=code_block_41.out2)
getParameterValueByName_15 = Element.GetParameterValueByName(element=family_types, parameterName=code_block_41.out3)
getParameterValueByName_16 = Element.GetParameterValueByName(element=family_types, parameterName=code_block_41.out4)
code_block_42 = CodeBlock(a=getParameterValueByName_16) { a:int; }
getParameterValueByName_17 = Element.GetParameterValueByName(element=family_types, parameterName=code_block_41.out5)
getParameterValueByName_18 = Element.GetParameterValueByName(element=family_types, parameterName=code_block_41.out6)
getParameterValueByName_19 = Element.GetParameterValueByName(element=family_types, parameterName=code_block_41.out7)
getParameterValueByName_20 = Element.GetParameterValueByName(element=family_types, parameterName=code_block_41.out8)
getParameterValueByName_21 = Element.GetParameterValueByName(element=family_types, parameterName=code_block_41.out9)
getParameterValueByName_22 = Element.GetParameterValueByName(element=family_types, parameterName=code_block_41.out11)
getParameterValueByName_23 = Element.GetParameterValueByName(element=family_types, parameterName=code_block_41.out10)
getParameterValueByName_24 = Element.GetParameterValueByName(element=family_types, parameterName=code_block_41.out12)
getParameterValueByName_25 = Element.GetParameterValueByName(element=family_types, parameterName=code_block_41.out13)
getParameterValueByName_26 = Element.GetParameterValueByName(element=family_types, parameterName=code_block_41.out14)
getParameterValueByName_27 = Element.GetParameterValueByName(element=family_types, parameterName=code_block_41.out18)
getParameterValueByName_28 = Element.GetParameterValueByName(element=family_types, parameterName=code_block_41.out15)
getParameterValueByName_29 = Element.GetParameterValueByName(element=family_types, parameterName=code_block_41.out16)
getParameterValueByName_30 = Element.GetParameterValueByName(element=family_types, parameterName=code_block_41.out27)
getParameterValueByName_31 = Element.GetParameterValueByName(element=family_types, parameterName=code_block_41.out17)
getParameterValueByName_32 = Element.GetParameterValueByName(element=family_types, parameterName=code_block_41.out19)
getParameterValueByName_33 = Element.GetParameterValueByName(element=family_types, parameterName=code_block_41.out20)
getParameterValueByName_34 = Element.GetParameterValueByName(element=family_types, parameterName=code_block_41.out21)
getParameterValueByName_35 = Element.GetParameterValueByName(element=family_types, parameterName=code_block_41.out22)
getParameterValueByName_36 = Element.GetParameterValueByName(element=family_types, parameterName=code_block_41.out23)
getParameterValueByName_37 = Element.GetParameterValueByName(element=family_types, parameterName=code_block_41.out24)
getParameterValueByName_38 = Element.GetParameterValueByName(element=family_types, parameterName=code_block_41.out25)
getParameterValueByName_39 = Element.GetParameterValueByName(element=family_types, parameterName=code_block_41.out26)

# group: Unit Converters
code_block_43 = CodeBlock(x=getParameterValueByName_12) { x; Math.Ceiling(x*328.08/100000000); }
code_block_44 = CodeBlock(x=getParameterValueByName_19) { x; Math.Ceiling(x*328.08/100000000); }
code_block_45 = CodeBlock(x=getParameterValueByName_22) { x; Math.Ceiling(x*328.08/100000000); }
code_block_46 = CodeBlock(x=getParameterValueByName_27) { x; Math.Ceiling(x*328.08/100000000); }

code_block_47 = CodeBlock { 86; }

# group: Design Checker
castInPlate_SGN09_Wall = DesignCheck.Connections.SteelToConcrete.CastInPlate.Eurocode.UK_NA.CastInPlate_SGN09_Wall.CastInPlate_SGN09_Wall(watch_3, toNumber_2, toNumber, code_block_33.d_y, code_block_33.d_z, code_block_35.rho_y, code_block_37.rho_z, code_block_43.out1, getParameterValueByName_13, getParameterValueByName_14, getParameterValueByName_15, code_block_42, getParameterValueByName_17, getParameterValueByName_18, code_block_44.out1, getParameterValueByName_20, getParameterValueByName_21, code_block_45.out1, getParameterValueByName_23, code_block_47, getParameterValueByName_24, getParameterValueByName_25, getParameterValueByName_26, code_block_46.out1, getParameterValueByName_28, getParameterValueByName_29, getParameterValueByName_30, getParameterValueByName_31, getParameterValueByName_32, getParameterValueByName_33, getParameterValueByName_34, getParameterValueByName_35, getParameterValueByName_36, getParameterValueByName_37, getParameterValueByName_38)
code_block_48 = CodeBlock(x=castInPlate_SGN09_Wall) { Looper(x); }
watch_5 = Watch(code_block_48)
code_block_49 = CodeBlock(x=castInPlate_SGN09_Wall) { CalcLooper(x); }
watch_6 = Watch(code_block_49)

# group: Output utilisations
plateUtilisation = DesignCheck.Connections.SteelToConcrete.CastInPlate.Eurocode.UK_NA.CastInPlate_SGN09_Wall.plateUtilisation(castInPlate_SGN09_Wall)
studUtilisation = DesignCheck.Connections.SteelToConcrete.CastInPlate.Eurocode.UK_NA.CastInPlate_SGN09_Wall.studUtilisation(castInPlate_SGN09_Wall)
punchingUtilisation = DesignCheck.Connections.SteelToConcrete.CastInPlate.Eurocode.UK_NA.CastInPlate_SGN09_Wall.punchingUtilisation(castInPlate_SGN09_Wall)
barUtilisation = DesignCheck.Connections.SteelToConcrete.CastInPlate.Eurocode.UK_NA.CastInPlate_SGN09_Wall.barUtilisation(castInPlate_SGN09_Wall)

# group: Output boolean
create = List.Create(plateUtilisation, studUtilisation, punchingUtilisation)
transpose = List.Transpose(create)
python_script_4 = Python(IN[0]=transpose)  # unwired: IN[1], IN[2]
# ---------- python_script_4.python (23 lines) ----------
import clr
clr.AddReference('ProtoGeometry')
from Autodesk.DesignScript.Geometry import *
#The inputs to this node will be stored as a list in the IN variables.
dataEnteringNode = IN
IN[1] = bool(1)
IN[2] = bool(0)

maxlist = []
boollist = []

for i in IN[0]:
	maxlist.append(max(i))
	if max(i) == 0:
		boollist.append(IN[2])
	elif max(i) < 1:
		boollist.append(IN[1])
	else: boollist.append(IN[2])


#Assign your output to the OUT variable.

OUT = boollist
# ----------------------------------------

# group: Filter Beams By Pass/Fail
filterByBoolMask_5 = List.FilterByBoolMask(list=setRotation, mask=python_script_4)
code_block_50 = CodeBlock { 0; 255; 0; }
byARGB = Color.ByARGB(r=code_block_50.out0, g=code_block_50.out1, b=code_block_50.out2)
overrideColorInView = Element.OverrideColorInView(element=filterByBoolMask_5.in, color=byARGB)

# group: CiP Family Type
family_types_2 = FamilyTypes("Cast in Plate  - Type Family:2x3 Studs, 2xB16 Anchors")

# group: Change CiP Type
code_block_51 = CodeBlock { "Type"; }
setParameterByName = Element.SetParameterByName(element=filterByBoolMask_5.out, parameterName=code_block_51, value=family_types_2)

# group: Filter
filterByBoolMask_6 = List.FilterByBoolMask(list=watch_3, mask=python_script_4)
filterByBoolMask_7 = List.FilterByBoolMask(list=toNumber_2, mask=python_script_4)
filterByBoolMask_8 = List.FilterByBoolMask(list=toNumber, mask=python_script_4)
filterByBoolMask_9 = List.FilterByBoolMask(list=code_block_33.d_y, mask=python_script_4)
filterByBoolMask_10 = List.FilterByBoolMask(list=code_block_33.d_z, mask=python_script_4)
filterByBoolMask_11 = List.FilterByBoolMask(list=code_block_35.rho_y, mask=python_script_4)
filterByBoolMask_12 = List.FilterByBoolMask(list=code_block_37.rho_z, mask=python_script_4)

# group: CiP Parameters
getParameterValueByName_40 = Element.GetParameterValueByName(element=family_types_2, parameterName=code_block_41.out0)
getParameterValueByName_41 = Element.GetParameterValueByName(element=family_types_2, parameterName=code_block_41.out1)
getParameterValueByName_42 = Element.GetParameterValueByName(element=family_types_2, parameterName=code_block_41.out2)
getParameterValueByName_43 = Element.GetParameterValueByName(element=family_types_2, parameterName=code_block_41.out3)
getParameterValueByName_44 = Element.GetParameterValueByName(element=family_types_2, parameterName=code_block_41.out4)
code_block_52 = CodeBlock(a=getParameterValueByName_44) { a:int; }
getParameterValueByName_45 = Element.GetParameterValueByName(element=family_types_2, parameterName=code_block_41.out5)
getParameterValueByName_46 = Element.GetParameterValueByName(element=family_types_2, parameterName=code_block_41.out6)
getParameterValueByName_47 = Element.GetParameterValueByName(element=family_types_2, parameterName=code_block_41.out7)
getParameterValueByName_48 = Element.GetParameterValueByName(element=family_types_2, parameterName=code_block_41.out8)
getParameterValueByName_49 = Element.GetParameterValueByName(element=family_types_2, parameterName=code_block_41.out9)
getParameterValueByName_50 = Element.GetParameterValueByName(element=family_types_2, parameterName=code_block_41.out11)
getParameterValueByName_51 = Element.GetParameterValueByName(element=family_types_2, parameterName=code_block_41.out10)
getParameterValueByName_52 = Element.GetParameterValueByName(element=family_types_2, parameterName=code_block_41.out12)
getParameterValueByName_53 = Element.GetParameterValueByName(element=family_types_2, parameterName=code_block_41.out13)
getParameterValueByName_54 = Element.GetParameterValueByName(element=family_types_2, parameterName=code_block_41.out14)
getParameterValueByName_55 = Element.GetParameterValueByName(element=family_types_2, parameterName=code_block_41.out18)
getParameterValueByName_56 = Element.GetParameterValueByName(element=family_types_2, parameterName=code_block_41.out15)
getParameterValueByName_57 = Element.GetParameterValueByName(element=family_types_2, parameterName=code_block_41.out16)
getParameterValueByName_58 = Element.GetParameterValueByName(element=family_types_2, parameterName=code_block_41.out27)
getParameterValueByName_59 = Element.GetParameterValueByName(element=family_types_2, parameterName=code_block_41.out17)
getParameterValueByName_60 = Element.GetParameterValueByName(element=family_types_2, parameterName=code_block_41.out19)
getParameterValueByName_61 = Element.GetParameterValueByName(element=family_types_2, parameterName=code_block_41.out20)
getParameterValueByName_62 = Element.GetParameterValueByName(element=family_types_2, parameterName=code_block_41.out21)
getParameterValueByName_63 = Element.GetParameterValueByName(element=family_types_2, parameterName=code_block_41.out22)
getParameterValueByName_64 = Element.GetParameterValueByName(element=family_types_2, parameterName=code_block_41.out23)
getParameterValueByName_65 = Element.GetParameterValueByName(element=family_types_2, parameterName=code_block_41.out24)
getParameterValueByName_66 = Element.GetParameterValueByName(element=family_types_2, parameterName=code_block_41.out25)
getParameterValueByName_67 = Element.GetParameterValueByName(element=family_types_2, parameterName=code_block_41.out26)

# group: Unit Converters
code_block_53 = CodeBlock(x=getParameterValueByName_40) { x; Math.Ceiling(x*328.08/100000000); }
code_block_54 = CodeBlock(x=getParameterValueByName_47) { x; Math.Ceiling(x*328.08/100000000); }
code_block_55 = CodeBlock(x=getParameterValueByName_50) { x; Math.Ceiling(x*328.08/100000000); }
code_block_56 = CodeBlock(x=getParameterValueByName_55) { x; Math.Ceiling(x*328.08/100000000); }

code_block_57 = CodeBlock { 86; }

# group: Design Checker
castInPlate_SGN09_Wall_2 = DesignCheck.Connections.SteelToConcrete.CastInPlate.Eurocode.UK_NA.CastInPlate_SGN09_Wall.CastInPlate_SGN09_Wall(filterByBoolMask_6.out, filterByBoolMask_7.out, filterByBoolMask_8.out, filterByBoolMask_9.out, filterByBoolMask_10.out, filterByBoolMask_11.out, filterByBoolMask_12.out, code_block_53.out1, getParameterValueByName_41, getParameterValueByName_42, getParameterValueByName_43, code_block_52, getParameterValueByName_45, getParameterValueByName_46, code_block_54.out1, getParameterValueByName_48, getParameterValueByName_49, code_block_55.out1, getParameterValueByName_51, code_block_57, getParameterValueByName_52, getParameterValueByName_53, getParameterValueByName_54, code_block_56.out1, getParameterValueByName_56, getParameterValueByName_57, getParameterValueByName_58, getParameterValueByName_59, getParameterValueByName_60, getParameterValueByName_61, getParameterValueByName_62, getParameterValueByName_63, getParameterValueByName_64, getParameterValueByName_65, getParameterValueByName_66)
code_block_58 = CodeBlock(x=castInPlate_SGN09_Wall_2) { Looper(x); }
watch_7 = Watch(code_block_58)
code_block_59 = CodeBlock(x=castInPlate_SGN09_Wall_2) { CalcLooper(x); }
watch_8 = Watch(code_block_59)

# group: Output utilisations
plateUtilisation_2 = DesignCheck.Connections.SteelToConcrete.CastInPlate.Eurocode.UK_NA.CastInPlate_SGN09_Wall.plateUtilisation(castInPlate_SGN09_Wall_2)
studUtilisation_2 = DesignCheck.Connections.SteelToConcrete.CastInPlate.Eurocode.UK_NA.CastInPlate_SGN09_Wall.studUtilisation(castInPlate_SGN09_Wall_2)
punchingUtilisation_2 = DesignCheck.Connections.SteelToConcrete.CastInPlate.Eurocode.UK_NA.CastInPlate_SGN09_Wall.punchingUtilisation(castInPlate_SGN09_Wall_2)
barUtilisation_2 = DesignCheck.Connections.SteelToConcrete.CastInPlate.Eurocode.UK_NA.CastInPlate_SGN09_Wall.barUtilisation(castInPlate_SGN09_Wall_2)

# group: Output boolean
create_2 = List.Create(plateUtilisation_2, studUtilisation_2, punchingUtilisation_2)
transpose_2 = List.Transpose(create_2)
python_script_5 = Python(IN[0]=transpose_2)  # unwired: IN[1], IN[2]; same code as python_script_4

# group: Filter Beams By Pass/Fail
filterByBoolMask_13 = List.FilterByBoolMask(list=setParameterByName, mask=python_script_5)
code_block_60 = CodeBlock { 0; 255; 0; }
byARGB_2 = Color.ByARGB(r=code_block_60.out0, g=code_block_60.out1, b=code_block_60.out2)
overrideColorInView_2 = Element.OverrideColorInView(element=filterByBoolMask_13.in, color=byARGB_2)

# group: CiP Family Type
family_types_3 = FamilyTypes("Cast in Plate  - Type Family:2x4 Studs, 2xB16 Anchors")

# group: Change CiP Type
code_block_61 = CodeBlock { "Type"; }
setParameterByName_2 = Element.SetParameterByName(element=filterByBoolMask_13.out, parameterName=code_block_61, value=family_types_3)

# group: Filter
filterByBoolMask_14 = List.FilterByBoolMask(list=filterByBoolMask_6.out, mask=python_script_5)
filterByBoolMask_15 = List.FilterByBoolMask(list=filterByBoolMask_7.out, mask=python_script_5)
filterByBoolMask_16 = List.FilterByBoolMask(list=filterByBoolMask_8.out, mask=python_script_5)
filterByBoolMask_17 = List.FilterByBoolMask(list=filterByBoolMask_9.out, mask=python_script_5)
filterByBoolMask_18 = List.FilterByBoolMask(list=filterByBoolMask_10.out, mask=python_script_5)
filterByBoolMask_19 = List.FilterByBoolMask(list=filterByBoolMask_11.out, mask=python_script_5)
filterByBoolMask_20 = List.FilterByBoolMask(list=filterByBoolMask_12.out, mask=python_script_5)

# group: CiP Parameters
getParameterValueByName_68 = Element.GetParameterValueByName(element=family_types_3, parameterName=code_block_41.out0)
getParameterValueByName_69 = Element.GetParameterValueByName(element=family_types_3, parameterName=code_block_41.out1)
getParameterValueByName_70 = Element.GetParameterValueByName(element=family_types_3, parameterName=code_block_41.out2)
getParameterValueByName_71 = Element.GetParameterValueByName(element=family_types_3, parameterName=code_block_41.out3)
getParameterValueByName_72 = Element.GetParameterValueByName(element=family_types_3, parameterName=code_block_41.out4)
code_block_62 = CodeBlock(a=getParameterValueByName_72) { a:int; }
getParameterValueByName_73 = Element.GetParameterValueByName(element=family_types_3, parameterName=code_block_41.out5)
getParameterValueByName_74 = Element.GetParameterValueByName(element=family_types_3, parameterName=code_block_41.out6)
getParameterValueByName_75 = Element.GetParameterValueByName(element=family_types_3, parameterName=code_block_41.out7)
getParameterValueByName_76 = Element.GetParameterValueByName(element=family_types_3, parameterName=code_block_41.out8)
getParameterValueByName_77 = Element.GetParameterValueByName(element=family_types_3, parameterName=code_block_41.out9)
getParameterValueByName_78 = Element.GetParameterValueByName(element=family_types_3, parameterName=code_block_41.out11)
getParameterValueByName_79 = Element.GetParameterValueByName(element=family_types_3, parameterName=code_block_41.out10)
getParameterValueByName_80 = Element.GetParameterValueByName(element=family_types_3, parameterName=code_block_41.out12)
getParameterValueByName_81 = Element.GetParameterValueByName(element=family_types_3, parameterName=code_block_41.out13)
getParameterValueByName_82 = Element.GetParameterValueByName(element=family_types_3, parameterName=code_block_41.out14)
getParameterValueByName_83 = Element.GetParameterValueByName(element=family_types_3, parameterName=code_block_41.out18)
getParameterValueByName_84 = Element.GetParameterValueByName(element=family_types_3, parameterName=code_block_41.out15)
getParameterValueByName_85 = Element.GetParameterValueByName(element=family_types_3, parameterName=code_block_41.out16)
getParameterValueByName_86 = Element.GetParameterValueByName(element=family_types_3, parameterName=code_block_41.out27)
getParameterValueByName_87 = Element.GetParameterValueByName(element=family_types_3, parameterName=code_block_41.out17)
getParameterValueByName_88 = Element.GetParameterValueByName(element=family_types_3, parameterName=code_block_41.out19)
getParameterValueByName_89 = Element.GetParameterValueByName(element=family_types_3, parameterName=code_block_41.out20)
getParameterValueByName_90 = Element.GetParameterValueByName(element=family_types_3, parameterName=code_block_41.out21)
getParameterValueByName_91 = Element.GetParameterValueByName(element=family_types_3, parameterName=code_block_41.out22)
getParameterValueByName_92 = Element.GetParameterValueByName(element=family_types_3, parameterName=code_block_41.out23)
getParameterValueByName_93 = Element.GetParameterValueByName(element=family_types_3, parameterName=code_block_41.out24)
getParameterValueByName_94 = Element.GetParameterValueByName(element=family_types_3, parameterName=code_block_41.out25)
getParameterValueByName_95 = Element.GetParameterValueByName(element=family_types_3, parameterName=code_block_41.out26)

# group: Unit Converters
code_block_63 = CodeBlock(x=getParameterValueByName_68) { x; Math.Ceiling(x*328.08/100000000); }
code_block_64 = CodeBlock(x=getParameterValueByName_75) { x; Math.Ceiling(x*328.08/100000000); }
code_block_65 = CodeBlock(x=getParameterValueByName_78) { x; Math.Ceiling(x*328.08/100000000); }
code_block_66 = CodeBlock(x=getParameterValueByName_83) { x; Math.Ceiling(x*328.08/100000000); }

code_block_67 = CodeBlock { 86; }

# group: Design Checker
castInPlate_SGN09_Wall_3 = DesignCheck.Connections.SteelToConcrete.CastInPlate.Eurocode.UK_NA.CastInPlate_SGN09_Wall.CastInPlate_SGN09_Wall(filterByBoolMask_14.out, filterByBoolMask_15.out, filterByBoolMask_16.out, filterByBoolMask_17.out, filterByBoolMask_18.out, filterByBoolMask_19.out, filterByBoolMask_20.out, code_block_63.out1, getParameterValueByName_69, getParameterValueByName_70, getParameterValueByName_71, code_block_62, getParameterValueByName_73, getParameterValueByName_74, code_block_64.out1, getParameterValueByName_76, getParameterValueByName_77, code_block_65.out1, getParameterValueByName_79, code_block_67, getParameterValueByName_80, getParameterValueByName_81, getParameterValueByName_82, code_block_66.out1, getParameterValueByName_84, getParameterValueByName_85, getParameterValueByName_86, getParameterValueByName_87, getParameterValueByName_88, getParameterValueByName_89, getParameterValueByName_90, getParameterValueByName_91, getParameterValueByName_92, getParameterValueByName_93, getParameterValueByName_94)
code_block_68 = CodeBlock(x=castInPlate_SGN09_Wall_3) { Looper(x); }
watch_9 = Watch(code_block_68)
code_block_69 = CodeBlock(x=castInPlate_SGN09_Wall_3) { CalcLooper(x); }
watch_10 = Watch(code_block_69)

# group: Output utilisations
plateUtilisation_3 = DesignCheck.Connections.SteelToConcrete.CastInPlate.Eurocode.UK_NA.CastInPlate_SGN09_Wall.plateUtilisation(castInPlate_SGN09_Wall_3)
studUtilisation_3 = DesignCheck.Connections.SteelToConcrete.CastInPlate.Eurocode.UK_NA.CastInPlate_SGN09_Wall.studUtilisation(castInPlate_SGN09_Wall_3)
punchingUtilisation_3 = DesignCheck.Connections.SteelToConcrete.CastInPlate.Eurocode.UK_NA.CastInPlate_SGN09_Wall.punchingUtilisation(castInPlate_SGN09_Wall_3)
barUtilisation_3 = DesignCheck.Connections.SteelToConcrete.CastInPlate.Eurocode.UK_NA.CastInPlate_SGN09_Wall.barUtilisation(castInPlate_SGN09_Wall_3)

# group: Output boolean
create_3 = List.Create(plateUtilisation_3, studUtilisation_3, punchingUtilisation_3)
transpose_3 = List.Transpose(create_3)
python_script_6 = Python(IN[0]=transpose_3)  # unwired: IN[1], IN[2]; same code as python_script_4

# group: Filter Beams By Pass/Fail
filterByBoolMask_21 = List.FilterByBoolMask(list=setParameterByName_2, mask=python_script_6)
code_block_70 = CodeBlock { 0; 255; 0; }
byARGB_3 = Color.ByARGB(r=code_block_70.out0, g=code_block_70.out1, b=code_block_70.out2)
overrideColorInView_3 = Element.OverrideColorInView(element=filterByBoolMask_21.in, color=byARGB_3)

# group: CiP Family Type
family_types_4 = FamilyTypes("Cast in Plate  - Type Family:2x5 Studs, 2xB16 Anchors")

# group: Change CiP Type
code_block_71 = CodeBlock { "Type"; }
setParameterByName_3 = Element.SetParameterByName(element=filterByBoolMask_21.out, parameterName=code_block_71, value=family_types_4)

# group: Filter
filterByBoolMask_22 = List.FilterByBoolMask(list=filterByBoolMask_14.out, mask=python_script_6)
filterByBoolMask_23 = List.FilterByBoolMask(list=filterByBoolMask_15.out, mask=python_script_6)
filterByBoolMask_24 = List.FilterByBoolMask(list=filterByBoolMask_16.out, mask=python_script_6)
filterByBoolMask_25 = List.FilterByBoolMask(list=filterByBoolMask_17.out, mask=python_script_6)
filterByBoolMask_26 = List.FilterByBoolMask(list=filterByBoolMask_18.out, mask=python_script_6)
filterByBoolMask_27 = List.FilterByBoolMask(list=filterByBoolMask_19.out, mask=python_script_6)
filterByBoolMask_28 = List.FilterByBoolMask(list=filterByBoolMask_20.out, mask=python_script_6)

# group: CiP Parameters
getParameterValueByName_96 = Element.GetParameterValueByName(element=family_types_4, parameterName=code_block_41.out0)
getParameterValueByName_97 = Element.GetParameterValueByName(element=family_types_4, parameterName=code_block_41.out1)
getParameterValueByName_98 = Element.GetParameterValueByName(element=family_types_4, parameterName=code_block_41.out2)
getParameterValueByName_99 = Element.GetParameterValueByName(element=family_types_4, parameterName=code_block_41.out3)
getParameterValueByName_100 = Element.GetParameterValueByName(element=family_types_4, parameterName=code_block_41.out4)
code_block_72 = CodeBlock(a=getParameterValueByName_100) { a:int; }
getParameterValueByName_101 = Element.GetParameterValueByName(element=family_types_4, parameterName=code_block_41.out5)
getParameterValueByName_102 = Element.GetParameterValueByName(element=family_types_4, parameterName=code_block_41.out6)
getParameterValueByName_103 = Element.GetParameterValueByName(element=family_types_4, parameterName=code_block_41.out7)
getParameterValueByName_104 = Element.GetParameterValueByName(element=family_types_4, parameterName=code_block_41.out8)
getParameterValueByName_105 = Element.GetParameterValueByName(element=family_types_4, parameterName=code_block_41.out9)
getParameterValueByName_106 = Element.GetParameterValueByName(element=family_types_4, parameterName=code_block_41.out11)
getParameterValueByName_107 = Element.GetParameterValueByName(element=family_types_4, parameterName=code_block_41.out10)
getParameterValueByName_108 = Element.GetParameterValueByName(element=family_types_4, parameterName=code_block_41.out12)
getParameterValueByName_109 = Element.GetParameterValueByName(element=family_types_4, parameterName=code_block_41.out13)
getParameterValueByName_110 = Element.GetParameterValueByName(element=family_types_4, parameterName=code_block_41.out14)
getParameterValueByName_111 = Element.GetParameterValueByName(element=family_types_4, parameterName=code_block_41.out18)
getParameterValueByName_112 = Element.GetParameterValueByName(element=family_types_4, parameterName=code_block_41.out15)
getParameterValueByName_113 = Element.GetParameterValueByName(element=family_types_4, parameterName=code_block_41.out16)
getParameterValueByName_114 = Element.GetParameterValueByName(element=family_types_4, parameterName=code_block_41.out27)
getParameterValueByName_115 = Element.GetParameterValueByName(element=family_types_4, parameterName=code_block_41.out17)
getParameterValueByName_116 = Element.GetParameterValueByName(element=family_types_4, parameterName=code_block_41.out19)
getParameterValueByName_117 = Element.GetParameterValueByName(element=family_types_4, parameterName=code_block_41.out20)
getParameterValueByName_118 = Element.GetParameterValueByName(element=family_types_4, parameterName=code_block_41.out21)
getParameterValueByName_119 = Element.GetParameterValueByName(element=family_types_4, parameterName=code_block_41.out22)
getParameterValueByName_120 = Element.GetParameterValueByName(element=family_types_4, parameterName=code_block_41.out23)
getParameterValueByName_121 = Element.GetParameterValueByName(element=family_types_4, parameterName=code_block_41.out24)
getParameterValueByName_122 = Element.GetParameterValueByName(element=family_types_4, parameterName=code_block_41.out25)
getParameterValueByName_123 = Element.GetParameterValueByName(element=family_types_4, parameterName=code_block_41.out26)

# group: Unit Converters
code_block_73 = CodeBlock(x=getParameterValueByName_96) { x; Math.Ceiling(x*328.08/100000000); }
code_block_74 = CodeBlock(x=getParameterValueByName_103) { x; Math.Ceiling(x*328.08/100000000); }
code_block_75 = CodeBlock(x=getParameterValueByName_106) { x; Math.Ceiling(x*328.08/100000000); }
code_block_76 = CodeBlock(x=getParameterValueByName_111) { x; Math.Ceiling(x*328.08/100000000); }

code_block_77 = CodeBlock { 86; }

# group: Design Checker
castInPlate_SGN09_Wall_4 = DesignCheck.Connections.SteelToConcrete.CastInPlate.Eurocode.UK_NA.CastInPlate_SGN09_Wall.CastInPlate_SGN09_Wall(filterByBoolMask_22.out, filterByBoolMask_23.out, filterByBoolMask_24.out, filterByBoolMask_25.out, filterByBoolMask_26.out, filterByBoolMask_27.out, filterByBoolMask_28.out, code_block_73.out1, getParameterValueByName_97, getParameterValueByName_98, getParameterValueByName_99, code_block_72, getParameterValueByName_101, getParameterValueByName_102, code_block_74.out1, getParameterValueByName_104, getParameterValueByName_105, code_block_75.out1, getParameterValueByName_107, code_block_77, getParameterValueByName_108, getParameterValueByName_109, getParameterValueByName_110, code_block_76.out1, getParameterValueByName_112, getParameterValueByName_113, getParameterValueByName_114, getParameterValueByName_115, getParameterValueByName_116, getParameterValueByName_117, getParameterValueByName_118, getParameterValueByName_119, getParameterValueByName_120, getParameterValueByName_121, getParameterValueByName_122)
code_block_78 = CodeBlock(x=castInPlate_SGN09_Wall_4) { Looper(x); }
watch_11 = Watch(code_block_78)
code_block_79 = CodeBlock(x=castInPlate_SGN09_Wall_4) { CalcLooper(x); }
watch_12 = Watch(code_block_79)

# group: Output utilisations
plateUtilisation_4 = DesignCheck.Connections.SteelToConcrete.CastInPlate.Eurocode.UK_NA.CastInPlate_SGN09_Wall.plateUtilisation(castInPlate_SGN09_Wall_4)
studUtilisation_4 = DesignCheck.Connections.SteelToConcrete.CastInPlate.Eurocode.UK_NA.CastInPlate_SGN09_Wall.studUtilisation(castInPlate_SGN09_Wall_4)
punchingUtilisation_4 = DesignCheck.Connections.SteelToConcrete.CastInPlate.Eurocode.UK_NA.CastInPlate_SGN09_Wall.punchingUtilisation(castInPlate_SGN09_Wall_4)
barUtilisation_4 = DesignCheck.Connections.SteelToConcrete.CastInPlate.Eurocode.UK_NA.CastInPlate_SGN09_Wall.barUtilisation(castInPlate_SGN09_Wall_4)

# group: Output boolean
create_4 = List.Create(plateUtilisation_4, studUtilisation_4, punchingUtilisation_4)
transpose_4 = List.Transpose(create_4)
python_script_7 = Python(IN[0]=transpose_4)  # unwired: IN[1], IN[2]; same code as python_script_4

# group: Filter Beams By Pass/Fail
filterByBoolMask_29 = List.FilterByBoolMask(list=setParameterByName_3, mask=python_script_7)
code_block_80 = CodeBlock { 0; 255; 0; }
byARGB_4 = Color.ByARGB(r=code_block_80.out0, g=code_block_80.out1, b=code_block_80.out2)
overrideColorInView_4 = Element.OverrideColorInView(element=filterByBoolMask_29.in, color=byARGB_4)

# group: CiP Family Type
family_types_5 = FamilyTypes("Cast in Plate  - Type Family:2x6 Studs, 2xB16 Anchors")

# group: Change CiP Type
code_block_81 = CodeBlock { "Type"; }
setParameterByName_4 = Element.SetParameterByName(element=filterByBoolMask_29.out, parameterName=code_block_81, value=family_types_5)

# group: Filter
filterByBoolMask_30 = List.FilterByBoolMask(list=filterByBoolMask_22.out, mask=python_script_7)
filterByBoolMask_31 = List.FilterByBoolMask(list=filterByBoolMask_23.out, mask=python_script_7)
filterByBoolMask_32 = List.FilterByBoolMask(list=filterByBoolMask_24.out, mask=python_script_7)
filterByBoolMask_33 = List.FilterByBoolMask(list=filterByBoolMask_25.out, mask=python_script_7)
filterByBoolMask_34 = List.FilterByBoolMask(list=filterByBoolMask_26.out, mask=python_script_7)
filterByBoolMask_35 = List.FilterByBoolMask(list=filterByBoolMask_27.out, mask=python_script_7)
filterByBoolMask_36 = List.FilterByBoolMask(list=filterByBoolMask_28.out, mask=python_script_7)

# group: CiP Parameters
getParameterValueByName_124 = Element.GetParameterValueByName(element=family_types_5, parameterName=code_block_41.out0)
getParameterValueByName_125 = Element.GetParameterValueByName(element=family_types_5, parameterName=code_block_41.out1)
getParameterValueByName_126 = Element.GetParameterValueByName(element=family_types_5, parameterName=code_block_41.out2)
getParameterValueByName_127 = Element.GetParameterValueByName(element=family_types_5, parameterName=code_block_41.out3)
getParameterValueByName_128 = Element.GetParameterValueByName(element=family_types_5, parameterName=code_block_41.out4)
code_block_82 = CodeBlock(a=getParameterValueByName_128) { a:int; }
getParameterValueByName_129 = Element.GetParameterValueByName(element=family_types_5, parameterName=code_block_41.out5)
getParameterValueByName_130 = Element.GetParameterValueByName(element=family_types_5, parameterName=code_block_41.out6)
getParameterValueByName_131 = Element.GetParameterValueByName(element=family_types_5, parameterName=code_block_41.out7)
getParameterValueByName_132 = Element.GetParameterValueByName(element=family_types_5, parameterName=code_block_41.out8)
getParameterValueByName_133 = Element.GetParameterValueByName(element=family_types_5, parameterName=code_block_41.out9)
getParameterValueByName_134 = Element.GetParameterValueByName(element=family_types_5, parameterName=code_block_41.out11)
getParameterValueByName_135 = Element.GetParameterValueByName(element=family_types_5, parameterName=code_block_41.out10)
getParameterValueByName_136 = Element.GetParameterValueByName(element=family_types_5, parameterName=code_block_41.out12)
getParameterValueByName_137 = Element.GetParameterValueByName(element=family_types_5, parameterName=code_block_41.out13)
getParameterValueByName_138 = Element.GetParameterValueByName(element=family_types_5, parameterName=code_block_41.out14)
getParameterValueByName_139 = Element.GetParameterValueByName(element=family_types_5, parameterName=code_block_41.out18)
getParameterValueByName_140 = Element.GetParameterValueByName(element=family_types_5, parameterName=code_block_41.out15)
getParameterValueByName_141 = Element.GetParameterValueByName(element=family_types_5, parameterName=code_block_41.out16)
getParameterValueByName_142 = Element.GetParameterValueByName(element=family_types_5, parameterName=code_block_41.out27)
getParameterValueByName_143 = Element.GetParameterValueByName(element=family_types_5, parameterName=code_block_41.out17)
getParameterValueByName_144 = Element.GetParameterValueByName(element=family_types_5, parameterName=code_block_41.out19)
getParameterValueByName_145 = Element.GetParameterValueByName(element=family_types_5, parameterName=code_block_41.out20)
getParameterValueByName_146 = Element.GetParameterValueByName(element=family_types_5, parameterName=code_block_41.out21)
getParameterValueByName_147 = Element.GetParameterValueByName(element=family_types_5, parameterName=code_block_41.out22)
getParameterValueByName_148 = Element.GetParameterValueByName(element=family_types_5, parameterName=code_block_41.out23)
getParameterValueByName_149 = Element.GetParameterValueByName(element=family_types_5, parameterName=code_block_41.out24)
getParameterValueByName_150 = Element.GetParameterValueByName(element=family_types_5, parameterName=code_block_41.out25)
getParameterValueByName_151 = Element.GetParameterValueByName(element=family_types_5, parameterName=code_block_41.out26)

# group: Unit Converters
code_block_83 = CodeBlock(x=getParameterValueByName_124) { x; Math.Ceiling(x*328.08/100000000); }
code_block_84 = CodeBlock(x=getParameterValueByName_131) { x; Math.Ceiling(x*328.08/100000000); }
code_block_85 = CodeBlock(x=getParameterValueByName_134) { x; Math.Ceiling(x*328.08/100000000); }
code_block_86 = CodeBlock(x=getParameterValueByName_139) { x; Math.Ceiling(x*328.08/100000000); }

code_block_87 = CodeBlock { 86; }

# group: Design Checker
castInPlate_SGN09_Wall_5 = DesignCheck.Connections.SteelToConcrete.CastInPlate.Eurocode.UK_NA.CastInPlate_SGN09_Wall.CastInPlate_SGN09_Wall(filterByBoolMask_30.out, filterByBoolMask_31.out, filterByBoolMask_32.out, filterByBoolMask_33.out, filterByBoolMask_34.out, filterByBoolMask_35.out, filterByBoolMask_36.out, code_block_83.out1, getParameterValueByName_125, getParameterValueByName_126, getParameterValueByName_127, code_block_82, getParameterValueByName_129, getParameterValueByName_130, code_block_84.out1, getParameterValueByName_132, getParameterValueByName_133, code_block_85.out1, getParameterValueByName_135, code_block_87, getParameterValueByName_136, getParameterValueByName_137, getParameterValueByName_138, code_block_86.out1, getParameterValueByName_140, getParameterValueByName_141, getParameterValueByName_142, getParameterValueByName_143, getParameterValueByName_144, getParameterValueByName_145, getParameterValueByName_146, getParameterValueByName_147, getParameterValueByName_148, getParameterValueByName_149, getParameterValueByName_150)
code_block_88 = CodeBlock(x=castInPlate_SGN09_Wall_5) { Looper(x); }
watch_13 = Watch(code_block_88)
code_block_89 = CodeBlock(x=castInPlate_SGN09_Wall_5) { CalcLooper(x); }
watch_14 = Watch(code_block_89)

# group: Output utilisations
plateUtilisation_5 = DesignCheck.Connections.SteelToConcrete.CastInPlate.Eurocode.UK_NA.CastInPlate_SGN09_Wall.plateUtilisation(castInPlate_SGN09_Wall_5)
studUtilisation_5 = DesignCheck.Connections.SteelToConcrete.CastInPlate.Eurocode.UK_NA.CastInPlate_SGN09_Wall.studUtilisation(castInPlate_SGN09_Wall_5)
punchingUtilisation_5 = DesignCheck.Connections.SteelToConcrete.CastInPlate.Eurocode.UK_NA.CastInPlate_SGN09_Wall.punchingUtilisation(castInPlate_SGN09_Wall_5)
barUtilisation_5 = DesignCheck.Connections.SteelToConcrete.CastInPlate.Eurocode.UK_NA.CastInPlate_SGN09_Wall.barUtilisation(castInPlate_SGN09_Wall_5)

# group: Output boolean
create_5 = List.Create(plateUtilisation_5, studUtilisation_5, punchingUtilisation_5)
transpose_5 = List.Transpose(create_5)
python_script_8 = Python(IN[0]=transpose_5)  # unwired: IN[1], IN[2]; same code as python_script_4

# group: Filter Beams By Pass/Fail
filterByBoolMask_37 = List.FilterByBoolMask(list=setParameterByName_4, mask=python_script_8)
code_block_90 = CodeBlock { 0; 255; 0; }
byARGB_5 = Color.ByARGB(r=code_block_90.out0, g=code_block_90.out1, b=code_block_90.out2)
overrideColorInView_5 = Element.OverrideColorInView(element=filterByBoolMask_37.in, color=byARGB_5)

# group: Colour Beams That Failed
code_block_91 = CodeBlock { 255; 0; 0; }
byARGB_6 = Color.ByARGB(r=code_block_91.out0, g=code_block_91.out1, b=code_block_91.out2)
overrideColorInView_6 = Element.OverrideColorInView(element=filterByBoolMask_37.out, color=byARGB_6)

# group: Loop Codes
code_block_92 = CodeBlock()
# ---------- code_block_92.designscript (11 lines) ----------
def Looper(x:var[]..[]){
 newList = {};
 return = [Imperative]
 {
  for(i in 0..Count(x)-1)
  {
  newList[i] = x[i].Result;
  }
  return = newList;
 }
};
# ----------------------------------------
code_block_93 = CodeBlock()
# ---------- code_block_93.designscript (11 lines) ----------
def CalcLooper(x:CalculationOfBoolean[]..[]){
 newList = {};
 return = [Imperative]
 {
  for(i in 0..Count(x)-1)
  {
  newList[i] = x[i].Verbose;
  }
  return = newList;
 }
};
# ----------------------------------------

# group: Coordinates of Cast-In Plates at End 2
python_script_9 = Python(IN[0]=filterByBoolMask_2.in)  # same code as python_script
code_block_94 = CodeBlock(seq=python_script_9) { seq[0]; seq[1]; seq[2]; seq[3]; seq[4]; seq[5]; seq[6]; seq[7]; }
code_block_95 = CodeBlock(curveEndpoints=code_block_94.out1) { curveEndpoints; }
watch_15 = Watch(code_block_95)

# group: Beam Reactions End 2
watch_16 = Watch(code_block_40.out4)

# group: Place Cast-In Plates at End 2
code_block_96 = CodeBlock(list=code_block_95) { list; }
code_block_97 = CodeBlock(item=code_block_96) { Flatten({item}); }
string_from_object_5 = FromObject()  # unwired: arg0
code_block_98 = CodeBlock { "Point"; 2; 1; }
code_block_99 = CodeBlock(x=code_block_98.out0) { x:string; }
boolean_4 = BoolSelector(true)
contains_5 = String.Contains(searchFor=code_block_99, ignoreCase=boolean_4)  # unwired: str
compose_4 = ComposeFunctions(string_from_object_5, contains_5)  # "Function.Compose"
filter_2 = List.Filter(code_block_97, compose_4)
code_block_100 = CodeBlock(Match=filter_2) { Match; }
dropEveryNthItem_3 = List.DropEveryNthItem(list=code_block_100, n=code_block_98.out1, offset=code_block_98.out2)
translate_4 = Geometry.Translate(geometry=dropEveryNthItem_3)
Z_2 = Point.Z(translate_4)
dropEveryNthItem_4 = List.DropEveryNthItem(list=code_block_100, n=code_block_98.out1)
translate_5 = Geometry.Translate(geometry=dropEveryNthItem_4)
X_5 = Point.X(translate_5)
Y_6 = Point.Y(translate_5)

# group: Identify Where Cast-In Plates End 2 Hit RC Walls
categories_3 = Categories("Walls")
all_elements_of_category_3 = ElementsOfCategory(categories_3)
faces_2 = Element.Faces(all_elements_of_category_3)
byJoinedSurfaces_2 = PolySurface.ByJoinedSurfaces(faces_2)
boundingBox_2 = Geometry.BoundingBox(byJoinedSurfaces_2)
contains_6 = BoundingBox.Contains(boundingBox_2, translate_4@L1)
code_block_101 = CodeBlock { true; }
eq_3 = contains_6 == code_block_101
code_block_102 = CodeBlock { ""; }
if_9 = If(test=eq_3, true=all_elements_of_category_3, false=code_block_102)
code_block_103 = CodeBlock { ""; false; true; }
eq_4 = if_9 == code_block_103.out0
if_10 = If(test=eq_4, true=code_block_103.out1, false=code_block_103.out2)
filterByBoolMask_38 = List.FilterByBoolMask(list=if_9, mask=if_10)

# group: Wall Properties at End 2 Cast-In Plates
getParameterValueByName_152 = Element.GetParameterValueByName(element=filterByBoolMask_38.in, parameterName=code_block_27.out0)
flatten_9 = Flatten(getParameterValueByName_152)
toNumber_3 = String.ToNumber(flatten_9)
getParameterValueByName_153 = Element.GetParameterValueByName(element=filterByBoolMask_38.in, parameterName=code_block_27.out1)
string_from_object_6 = FromObject(getParameterValueByName_153)
code_block_104 = CodeBlock { "Thickness"; 1; }
split_2 = String.Split(string_from_object_6, code_block_104.out0)
getItemAtIndex_4 = List.GetItemAtIndex(list=split_2@L2, index=code_block_104.out1)
toNumber_4 = String.ToNumber(getItemAtIndex_4)
getParameterValueByName_154 = Element.GetParameterValueByName(element=filterByBoolMask_38.in, parameterName=code_block_27.out2)
code_block_105 = CodeBlock(x=getParameterValueByName_154) { x; x*25.4*12; }
flatten_10 = Flatten(code_block_105.out1)
getParameterValueByName_155 = Element.GetParameterValueByName(element=filterByBoolMask_38.in, parameterName=code_block_27.out3)
code_block_106 = CodeBlock(x=getParameterValueByName_155) { x; x*25.4*12; }
flatten_11 = Flatten(code_block_106.out1)
getParameterValueByName_156 = Element.GetParameterValueByName(element=filterByBoolMask_38.in, parameterName=code_block_27.out6)
code_block_107 = CodeBlock(x=getParameterValueByName_156) { x; x*25.4*12; }
flatten_12 = Flatten(code_block_107.out1)
code_block_108 = CodeBlock(t=toNumber_4, bar_dia_y=flatten_10, bar_dia_z=flatten_11, cover=flatten_12) { t; bar_dia_y; bar_dia_z; cover; d_y = t - cover - (bar_dia_y/2); d_z = t - cover - bar_dia_y - (bar_dia_z/2); }
getParameterValueByName_157 = Element.GetParameterValueByName(element=filterByBoolMask_38.in, parameterName=code_block_27.out4)
code_block_109 = CodeBlock(x=getParameterValueByName_157) { x; x*25.4*12; }
flatten_13 = Flatten(code_block_109.out1)
code_block_110 = CodeBlock(t=toNumber_4, bar_dia=flatten_10, bar_spc=flatten_13) { t; bar_dia; bar_spc; rho_y = (bar_dia*3.14*1000/bar_spc)/(t*1000); }
getParameterValueByName_158 = Element.GetParameterValueByName(element=filterByBoolMask_38.in, parameterName=code_block_27.out5)
code_block_111 = CodeBlock(x=getParameterValueByName_158) { x; x*25.4*12; }
flatten_14 = Flatten(code_block_111.out1)
code_block_112 = CodeBlock(t=toNumber_4, bar_dia=flatten_11, bar_spc=flatten_14) { t; bar_dia; bar_spc; rho_z = (bar_dia*3.14*1000/bar_spc)/(t*1000); }
code_block_113 = CodeBlock(t=toNumber_4) { t/2; }

# group: Design Checker
castInPlate_SGN09_Wall_6 = DesignCheck.Connections.SteelToConcrete.CastInPlate.Eurocode.UK_NA.CastInPlate_SGN09_Wall.CastInPlate_SGN09_Wall(watch_16, toNumber_3, toNumber_4, code_block_108.d_y, code_block_108.d_z, code_block_110.rho_y, code_block_112.rho_z, code_block_43.out1, getParameterValueByName_13, getParameterValueByName_14, getParameterValueByName_15, code_block_42, getParameterValueByName_17, getParameterValueByName_18, code_block_44.out1, getParameterValueByName_20, getParameterValueByName_21, code_block_45.out1, getParameterValueByName_23, code_block_47, getParameterValueByName_24, getParameterValueByName_25, getParameterValueByName_26, code_block_46.out1, getParameterValueByName_28, getParameterValueByName_29, getParameterValueByName_30, getParameterValueByName_31, getParameterValueByName_32, getParameterValueByName_33, getParameterValueByName_34, getParameterValueByName_35, getParameterValueByName_36, getParameterValueByName_37, getParameterValueByName_38)
code_block_114 = CodeBlock(x=castInPlate_SGN09_Wall_6) { Looper(x); }
watch_17 = Watch(code_block_114)
code_block_115 = CodeBlock(x=castInPlate_SGN09_Wall_6) { CalcLooper(x); }
watch_18 = Watch(code_block_115)

# group: Find main wall surface
area_2 = Surface.Area(faces_2)
ceiling_3 = Math.Ceiling(area_2)
maximumItem_2 = List.MaximumItem(area_2)
ceiling_4 = Math.Ceiling(maximumItem_2)
indexOf_2 = IndexOf(ceiling_3, ceiling_4, lacing=Longest)
code_block_116 = CodeBlock { 1; }
chop_2 = List.Chop(list=indexOf_2, lengths=code_block_116)

# group: Rotate Cast-In Plates End 2
filterByBoolMask_39 = List.FilterByBoolMask(list=faces_2, mask=if_10@L2)
getItemAtIndex_5 = List.GetItemAtIndex(list=filterByBoolMask_39.in@L2, index=chop_2@L2)
flatten_15 = Flatten(getItemAtIndex_5)
code_block_117 = CodeBlock { 0; 0.5; 0.5; }
normalAtParameter_3 = Surface.NormalAtParameter(surface=flatten_15, u=code_block_117.out1, v=code_block_117.out2, lacing=Longest)
X_6 = Vector.X(normalAtParameter_3)
code_block_118 = CodeBlock { 0; }
lt_4 = X_6 < code_block_118
if_11 = If(test=lt_4, true=code_block_118, false=X_6)
code_block_119 = CodeBlock { 1; }
add_6 = chop_2 + code_block_119
getItemAtIndex_6 = List.GetItemAtIndex(list=filterByBoolMask_39.in@L2, index=add_6@L2)
flatten_16 = Flatten(getItemAtIndex_6)
normalAtParameter_4 = Surface.NormalAtParameter(surface=flatten_16, u=code_block_117.out1, v=code_block_117.out2, lacing=Longest)
X_7 = Vector.X(normalAtParameter_4)
lt_5 = X_7 < code_block_118
if_12 = If(test=lt_5, true=code_block_118, false=X_7)
add_7 = if_11 + if_12
Y_7 = Vector.Y(normalAtParameter_3)
if_13 = If(test=lt_4, true=code_block_118, false=Y_7)
Y_8 = Vector.Y(normalAtParameter_4)
if_14 = If(test=lt_5, true=code_block_118, false=Y_8)
add_8 = if_13 + if_14
code_block_120 = CodeBlock { 0; }
byCoordinates_3 = Vector.ByCoordinates(x=add_7, y=add_8, z=code_block_120)
XAxis_2 = Vector.XAxis()
angleWithVector_2 = Vector.AngleWithVector(vector=byCoordinates_3, otherVector=XAxis_2)
Y_9 = Vector.Y(byCoordinates_3)
lt_6 = Y_9 < code_block_118
code_block_121 = CodeBlock { -1; 1; 0; 180; }
if_15 = If(test=lt_6, true=code_block_121.out0, false=code_block_121.out1)
mul_2 = angleWithVector_2 * if_15
if_16 = If(test=lt_6, true=code_block_121.out2, false=code_block_121.out3)
add_9 = mul_2 + if_16

ZAxis = Vector.ZAxis()
code_block_122 = CodeBlock { 180; }
rotate = Vector.Rotate(byCoordinates_3, ZAxis, code_block_122)

# group (continued): Place Cast-In Plates at End 2
translate_6 = Geometry.Translate(geometry=translate_4, direction=rotate, distance=code_block_113)
X_8 = Point.X(translate_6)
Y_10 = Point.Y(translate_6)
byCoordinates_4 = FamilyInstance.ByCoordinates(family_types, X_8, Y_10, Z_2)
setRotation_2 = FamilyInstance.SetRotation(familyInstance=byCoordinates_4, degree=add_9)
code_block_123 = CodeBlock(x1=X_8, x2=X_5, y1=Y_10, y2=Y_6) { x1; x2; y1; y2; (x2-x1)/(y2-y1); }
atan_2 = Math.Atan(code_block_123.out4)
add_10 = _ + atan_2  # unwired: arg0

# group: Output utilisations
plateUtilisation_6 = DesignCheck.Connections.SteelToConcrete.CastInPlate.Eurocode.UK_NA.CastInPlate_SGN09_Wall.plateUtilisation(castInPlate_SGN09_Wall_6)
studUtilisation_6 = DesignCheck.Connections.SteelToConcrete.CastInPlate.Eurocode.UK_NA.CastInPlate_SGN09_Wall.studUtilisation(castInPlate_SGN09_Wall_6)
punchingUtilisation_6 = DesignCheck.Connections.SteelToConcrete.CastInPlate.Eurocode.UK_NA.CastInPlate_SGN09_Wall.punchingUtilisation(castInPlate_SGN09_Wall_6)
barUtilisation_6 = DesignCheck.Connections.SteelToConcrete.CastInPlate.Eurocode.UK_NA.CastInPlate_SGN09_Wall.barUtilisation(castInPlate_SGN09_Wall_6)

# group: Output boolean
create_6 = List.Create(plateUtilisation_6, studUtilisation_6, punchingUtilisation_6)
transpose_6 = List.Transpose(create_6)
python_script_10 = Python(IN[0]=transpose_6)  # unwired: IN[1], IN[2]; same code as python_script_4

# group: Filter Beams By Pass/Fail
filterByBoolMask_40 = List.FilterByBoolMask(list=setRotation_2, mask=python_script_10)
code_block_124 = CodeBlock { 0; 255; 0; }
byARGB_7 = Color.ByARGB(r=code_block_124.out0, g=code_block_124.out1, b=code_block_124.out2)
overrideColorInView_7 = Element.OverrideColorInView(element=filterByBoolMask_40.in, color=byARGB_7)

# group: Change CiP Type
code_block_125 = CodeBlock { "Type"; }
setParameterByName_5 = Element.SetParameterByName(element=filterByBoolMask_40.out, parameterName=code_block_125, value=family_types_2)

# group: Filter
filterByBoolMask_41 = List.FilterByBoolMask(list=watch_16, mask=python_script_10)
filterByBoolMask_42 = List.FilterByBoolMask(list=toNumber_3, mask=python_script_10)
filterByBoolMask_43 = List.FilterByBoolMask(list=toNumber_4, mask=python_script_10)
filterByBoolMask_44 = List.FilterByBoolMask(list=code_block_108.d_y, mask=python_script_10)
filterByBoolMask_45 = List.FilterByBoolMask(list=code_block_108.d_z, mask=python_script_10)
filterByBoolMask_46 = List.FilterByBoolMask(list=code_block_110.rho_y, mask=python_script_10)
filterByBoolMask_47 = List.FilterByBoolMask(list=code_block_112.rho_z, mask=python_script_10)

# group: Design Checker
castInPlate_SGN09_Wall_7 = DesignCheck.Connections.SteelToConcrete.CastInPlate.Eurocode.UK_NA.CastInPlate_SGN09_Wall.CastInPlate_SGN09_Wall(filterByBoolMask_41.out, filterByBoolMask_42.out, filterByBoolMask_43.out, filterByBoolMask_44.out, filterByBoolMask_45.out, filterByBoolMask_46.out, filterByBoolMask_47.out, code_block_53.out1, getParameterValueByName_41, getParameterValueByName_42, getParameterValueByName_43, code_block_52, getParameterValueByName_45, getParameterValueByName_46, code_block_54.out1, getParameterValueByName_48, getParameterValueByName_49, code_block_55.out1, getParameterValueByName_51, code_block_57, getParameterValueByName_52, getParameterValueByName_53, getParameterValueByName_54, code_block_56.out1, getParameterValueByName_56, getParameterValueByName_57, getParameterValueByName_58, getParameterValueByName_59, getParameterValueByName_60, getParameterValueByName_61, getParameterValueByName_62, getParameterValueByName_63, getParameterValueByName_64, getParameterValueByName_65, getParameterValueByName_66)
code_block_126 = CodeBlock(x=castInPlate_SGN09_Wall_7) { Looper(x); }
watch_19 = Watch(code_block_126)
code_block_127 = CodeBlock(x=castInPlate_SGN09_Wall_7) { CalcLooper(x); }
watch_20 = Watch(code_block_127)

# group: Output utilisations
plateUtilisation_7 = DesignCheck.Connections.SteelToConcrete.CastInPlate.Eurocode.UK_NA.CastInPlate_SGN09_Wall.plateUtilisation(castInPlate_SGN09_Wall_7)
studUtilisation_7 = DesignCheck.Connections.SteelToConcrete.CastInPlate.Eurocode.UK_NA.CastInPlate_SGN09_Wall.studUtilisation(castInPlate_SGN09_Wall_7)
punchingUtilisation_7 = DesignCheck.Connections.SteelToConcrete.CastInPlate.Eurocode.UK_NA.CastInPlate_SGN09_Wall.punchingUtilisation(castInPlate_SGN09_Wall_7)
barUtilisation_7 = DesignCheck.Connections.SteelToConcrete.CastInPlate.Eurocode.UK_NA.CastInPlate_SGN09_Wall.barUtilisation(castInPlate_SGN09_Wall_7)

# group: Output boolean
create_7 = List.Create(plateUtilisation_7, studUtilisation_7, punchingUtilisation_7)
transpose_7 = List.Transpose(create_7)
python_script_11 = Python(IN[0]=transpose_7)  # unwired: IN[1], IN[2]; same code as python_script_4

# group: Filter Beams By Pass/Fail
filterByBoolMask_48 = List.FilterByBoolMask(list=setParameterByName_5, mask=python_script_11)
code_block_128 = CodeBlock { 0; 255; 0; }
byARGB_8 = Color.ByARGB(r=code_block_128.out0, g=code_block_128.out1, b=code_block_128.out2)
overrideColorInView_8 = Element.OverrideColorInView(element=filterByBoolMask_48.in, color=byARGB_8)

# group: Change CiP Type
code_block_129 = CodeBlock { "Type"; }
setParameterByName_6 = Element.SetParameterByName(element=filterByBoolMask_48.out, parameterName=code_block_129, value=family_types_3)

# group: Filter
filterByBoolMask_49 = List.FilterByBoolMask(list=filterByBoolMask_41.out, mask=python_script_11)
filterByBoolMask_50 = List.FilterByBoolMask(list=filterByBoolMask_42.out, mask=python_script_11)
filterByBoolMask_51 = List.FilterByBoolMask(list=filterByBoolMask_43.out, mask=python_script_11)
filterByBoolMask_52 = List.FilterByBoolMask(list=filterByBoolMask_44.out, mask=python_script_11)
filterByBoolMask_53 = List.FilterByBoolMask(list=filterByBoolMask_45.out, mask=python_script_11)
filterByBoolMask_54 = List.FilterByBoolMask(list=filterByBoolMask_46.out, mask=python_script_11)
filterByBoolMask_55 = List.FilterByBoolMask(list=filterByBoolMask_47.out, mask=python_script_11)

# group: Design Checker
castInPlate_SGN09_Wall_8 = DesignCheck.Connections.SteelToConcrete.CastInPlate.Eurocode.UK_NA.CastInPlate_SGN09_Wall.CastInPlate_SGN09_Wall(filterByBoolMask_49.out, filterByBoolMask_50.out, filterByBoolMask_51.out, filterByBoolMask_52.out, filterByBoolMask_53.out, filterByBoolMask_54.out, filterByBoolMask_55.out, code_block_63.out1, getParameterValueByName_69, getParameterValueByName_70, getParameterValueByName_71, code_block_62, getParameterValueByName_73, getParameterValueByName_74, code_block_64.out1, getParameterValueByName_76, getParameterValueByName_77, code_block_65.out1, getParameterValueByName_79, code_block_67, getParameterValueByName_80, getParameterValueByName_81, getParameterValueByName_82, code_block_66.out1, getParameterValueByName_84, getParameterValueByName_85, getParameterValueByName_86, getParameterValueByName_87, getParameterValueByName_88, getParameterValueByName_89, getParameterValueByName_90, getParameterValueByName_91, getParameterValueByName_92, getParameterValueByName_93, getParameterValueByName_94)
code_block_130 = CodeBlock(x=castInPlate_SGN09_Wall_8) { Looper(x); }
watch_21 = Watch(code_block_130)
code_block_131 = CodeBlock(x=castInPlate_SGN09_Wall_8) { CalcLooper(x); }
watch_22 = Watch(code_block_131)

# group: Output utilisations
plateUtilisation_8 = DesignCheck.Connections.SteelToConcrete.CastInPlate.Eurocode.UK_NA.CastInPlate_SGN09_Wall.plateUtilisation(castInPlate_SGN09_Wall_8)
studUtilisation_8 = DesignCheck.Connections.SteelToConcrete.CastInPlate.Eurocode.UK_NA.CastInPlate_SGN09_Wall.studUtilisation(castInPlate_SGN09_Wall_8)
punchingUtilisation_8 = DesignCheck.Connections.SteelToConcrete.CastInPlate.Eurocode.UK_NA.CastInPlate_SGN09_Wall.punchingUtilisation(castInPlate_SGN09_Wall_8)
barUtilisation_8 = DesignCheck.Connections.SteelToConcrete.CastInPlate.Eurocode.UK_NA.CastInPlate_SGN09_Wall.barUtilisation(castInPlate_SGN09_Wall_8)

# group: Output boolean
create_8 = List.Create(plateUtilisation_8, studUtilisation_8, punchingUtilisation_8)
transpose_8 = List.Transpose(create_8)
python_script_12 = Python(IN[0]=transpose_8)  # unwired: IN[1], IN[2]; same code as python_script_4

# group: Filter Beams By Pass/Fail
filterByBoolMask_56 = List.FilterByBoolMask(list=setParameterByName_6, mask=python_script_12)
code_block_132 = CodeBlock { 0; 255; 0; }
byARGB_9 = Color.ByARGB(r=code_block_132.out0, g=code_block_132.out1, b=code_block_132.out2)
overrideColorInView_9 = Element.OverrideColorInView(element=filterByBoolMask_56.in, color=byARGB_9)

# group: Change CiP Type
code_block_133 = CodeBlock { "Type"; }
setParameterByName_7 = Element.SetParameterByName(element=filterByBoolMask_56.out, parameterName=code_block_133, value=family_types_4)

# group: Filter
filterByBoolMask_57 = List.FilterByBoolMask(list=filterByBoolMask_49.out, mask=python_script_12)
filterByBoolMask_58 = List.FilterByBoolMask(list=filterByBoolMask_50.out, mask=python_script_12)
filterByBoolMask_59 = List.FilterByBoolMask(list=filterByBoolMask_51.out, mask=python_script_12)
filterByBoolMask_60 = List.FilterByBoolMask(list=filterByBoolMask_52.out, mask=python_script_12)
filterByBoolMask_61 = List.FilterByBoolMask(list=filterByBoolMask_53.out, mask=python_script_12)
filterByBoolMask_62 = List.FilterByBoolMask(list=filterByBoolMask_54.out, mask=python_script_12)
filterByBoolMask_63 = List.FilterByBoolMask(list=filterByBoolMask_55.out, mask=python_script_12)

# group: Design Checker
castInPlate_SGN09_Wall_9 = DesignCheck.Connections.SteelToConcrete.CastInPlate.Eurocode.UK_NA.CastInPlate_SGN09_Wall.CastInPlate_SGN09_Wall(filterByBoolMask_57.out, filterByBoolMask_58.out, filterByBoolMask_59.out, filterByBoolMask_60.out, filterByBoolMask_61.out, filterByBoolMask_62.out, filterByBoolMask_63.out, code_block_73.out1, getParameterValueByName_97, getParameterValueByName_98, getParameterValueByName_99, code_block_72, getParameterValueByName_101, getParameterValueByName_102, code_block_74.out1, getParameterValueByName_104, getParameterValueByName_105, code_block_75.out1, getParameterValueByName_107, code_block_77, getParameterValueByName_108, getParameterValueByName_109, getParameterValueByName_110, code_block_76.out1, getParameterValueByName_112, getParameterValueByName_113, getParameterValueByName_114, getParameterValueByName_115, getParameterValueByName_116, getParameterValueByName_117, getParameterValueByName_118, getParameterValueByName_119, getParameterValueByName_120, getParameterValueByName_121, getParameterValueByName_122)
code_block_134 = CodeBlock(x=castInPlate_SGN09_Wall_9) { Looper(x); }
watch_23 = Watch(code_block_134)
code_block_135 = CodeBlock(x=castInPlate_SGN09_Wall_9) { CalcLooper(x); }
watch_24 = Watch(code_block_135)

# group: Output utilisations
plateUtilisation_9 = DesignCheck.Connections.SteelToConcrete.CastInPlate.Eurocode.UK_NA.CastInPlate_SGN09_Wall.plateUtilisation(castInPlate_SGN09_Wall_9)
studUtilisation_9 = DesignCheck.Connections.SteelToConcrete.CastInPlate.Eurocode.UK_NA.CastInPlate_SGN09_Wall.studUtilisation(castInPlate_SGN09_Wall_9)
punchingUtilisation_9 = DesignCheck.Connections.SteelToConcrete.CastInPlate.Eurocode.UK_NA.CastInPlate_SGN09_Wall.punchingUtilisation(castInPlate_SGN09_Wall_9)
barUtilisation_9 = DesignCheck.Connections.SteelToConcrete.CastInPlate.Eurocode.UK_NA.CastInPlate_SGN09_Wall.barUtilisation(castInPlate_SGN09_Wall_9)

# group: Output boolean
create_9 = List.Create(plateUtilisation_9, studUtilisation_9, punchingUtilisation_9)
transpose_9 = List.Transpose(create_9)
python_script_13 = Python(IN[0]=transpose_9)  # unwired: IN[1], IN[2]; same code as python_script_4

# group: Filter Beams By Pass/Fail
filterByBoolMask_64 = List.FilterByBoolMask(list=setParameterByName_7, mask=python_script_13)
code_block_136 = CodeBlock { 0; 255; 0; }
byARGB_10 = Color.ByARGB(r=code_block_136.out0, g=code_block_136.out1, b=code_block_136.out2)
overrideColorInView_10 = Element.OverrideColorInView(element=filterByBoolMask_64.in, color=byARGB_10)

# group: Change CiP Type
code_block_137 = CodeBlock { "Type"; }
setParameterByName_8 = Element.SetParameterByName(element=filterByBoolMask_64.out, parameterName=code_block_137, value=family_types_5)

# group: Filter
filterByBoolMask_65 = List.FilterByBoolMask(list=filterByBoolMask_57.out, mask=python_script_13)
filterByBoolMask_66 = List.FilterByBoolMask(list=filterByBoolMask_58.out, mask=python_script_13)
filterByBoolMask_67 = List.FilterByBoolMask(list=filterByBoolMask_59.out, mask=python_script_13)
filterByBoolMask_68 = List.FilterByBoolMask(list=filterByBoolMask_60.out, mask=python_script_13)
filterByBoolMask_69 = List.FilterByBoolMask(list=filterByBoolMask_61.out, mask=python_script_13)
filterByBoolMask_70 = List.FilterByBoolMask(list=filterByBoolMask_62.out, mask=python_script_13)
filterByBoolMask_71 = List.FilterByBoolMask(list=filterByBoolMask_63.out, mask=python_script_13)

# group: Design Checker
castInPlate_SGN09_Wall_10 = DesignCheck.Connections.SteelToConcrete.CastInPlate.Eurocode.UK_NA.CastInPlate_SGN09_Wall.CastInPlate_SGN09_Wall(filterByBoolMask_65.out, filterByBoolMask_66.out, filterByBoolMask_67.out, filterByBoolMask_68.out, filterByBoolMask_69.out, filterByBoolMask_70.out, filterByBoolMask_71.out, code_block_83.out1, getParameterValueByName_125, getParameterValueByName_126, getParameterValueByName_127, code_block_82, getParameterValueByName_129, getParameterValueByName_130, code_block_84.out1, getParameterValueByName_132, getParameterValueByName_133, code_block_85.out1, getParameterValueByName_135, code_block_87, getParameterValueByName_136, getParameterValueByName_137, getParameterValueByName_138, code_block_86.out1, getParameterValueByName_140, getParameterValueByName_141, getParameterValueByName_142, getParameterValueByName_143, getParameterValueByName_144, getParameterValueByName_145, getParameterValueByName_146, getParameterValueByName_147, getParameterValueByName_148, getParameterValueByName_149, getParameterValueByName_150)
code_block_138 = CodeBlock(x=castInPlate_SGN09_Wall_10) { Looper(x); }
watch_25 = Watch(code_block_138)
code_block_139 = CodeBlock(x=castInPlate_SGN09_Wall_10) { CalcLooper(x); }
watch_26 = Watch(code_block_139)

# group: Output utilisations
plateUtilisation_10 = DesignCheck.Connections.SteelToConcrete.CastInPlate.Eurocode.UK_NA.CastInPlate_SGN09_Wall.plateUtilisation(castInPlate_SGN09_Wall_10)
studUtilisation_10 = DesignCheck.Connections.SteelToConcrete.CastInPlate.Eurocode.UK_NA.CastInPlate_SGN09_Wall.studUtilisation(castInPlate_SGN09_Wall_10)
punchingUtilisation_10 = DesignCheck.Connections.SteelToConcrete.CastInPlate.Eurocode.UK_NA.CastInPlate_SGN09_Wall.punchingUtilisation(castInPlate_SGN09_Wall_10)
barUtilisation_10 = DesignCheck.Connections.SteelToConcrete.CastInPlate.Eurocode.UK_NA.CastInPlate_SGN09_Wall.barUtilisation(castInPlate_SGN09_Wall_10)

# group: Output boolean
create_10 = List.Create(plateUtilisation_10, studUtilisation_10, punchingUtilisation_10)
transpose_10 = List.Transpose(create_10)
python_script_14 = Python(IN[0]=transpose_10)  # unwired: IN[1], IN[2]; same code as python_script_4

# group: Filter Beams By Pass/Fail
filterByBoolMask_72 = List.FilterByBoolMask(list=setParameterByName_8, mask=python_script_14)
code_block_140 = CodeBlock { 0; 255; 0; }
byARGB_11 = Color.ByARGB(r=code_block_140.out0, g=code_block_140.out1, b=code_block_140.out2)
overrideColorInView_11 = Element.OverrideColorInView(element=filterByBoolMask_72.in, color=byARGB_11)

# group: Colour Beams That Failed
code_block_141 = CodeBlock { 255; 0; 0; }
byARGB_12 = Color.ByARGB(r=code_block_141.out0, g=code_block_141.out1, b=code_block_141.out2)
overrideColorInView_12 = Element.OverrideColorInView(element=filterByBoolMask_72.out, color=byARGB_12)

watch_27 = Watch(code_block_43.out1)
watch_28 = Watch(getParameterValueByName_13)
watch_29 = Watch(getParameterValueByName_14)
watch_30 = Watch(code_block_44.out1)
watch_31 = Watch(code_block_45.out1)
watch_32 = Watch(code_block_46.out1)
watch_33 = Watch(getParameterValueByName_15)
watch_34 = Watch(code_block_42)
watch_35 = Watch(getParameterValueByName_17)
watch_36 = Watch(getParameterValueByName_18)
watch_37 = Watch(getParameterValueByName_20)
watch_38 = Watch(getParameterValueByName_21)
watch_39 = Watch(getParameterValueByName_23)
watch_40 = Watch(getParameterValueByName_31)
watch_41 = Watch(getParameterValueByName_29)
watch_42 = Watch(getParameterValueByName_28)
watch_43 = Watch(getParameterValueByName_26)
watch_44 = Watch(getParameterValueByName_25)
watch_45 = Watch(getParameterValueByName_24)
watch_46 = Watch(getParameterValueByName_39)
watch_47 = Watch(getParameterValueByName_32)
watch_48 = Watch(getParameterValueByName_33)
watch_49 = Watch(getParameterValueByName_34)
watch_50 = Watch(getParameterValueByName_35)
watch_51 = Watch(getParameterValueByName_36)
watch_52 = Watch(getParameterValueByName_37)
watch_53 = Watch(getParameterValueByName_38)
watch_54 = Watch(getParameterValueByName_30)
watch_55 = Watch(watch_3)
watch_56 = Watch(toNumber_2)
watch_57 = Watch(toNumber)
watch_58 = Watch(code_block_33.d_y)
watch_59 = Watch(code_block_33.d_z)
watch_60 = Watch(code_block_35.rho_y)
watch_61 = Watch(code_block_37.rho_z)
