# Dynamo graph DynamoTalk.dyn (Dynamo 1.3.0.875)

categories = Categories("Walls")
all_elements_of_category = ElementsOfCategory(categories)
count = List.Count(all_elements_of_category)
string_from_object = FromObject(count)
code_block = CodeBlock { "Area"; }
getParameterValueByName = Element.GetParameterValueByName(element=all_elements_of_category, parameterName=code_block)
sum = Math.Sum(getParameterValueByName)
ceiling = Math.Ceiling(sum)
string_from_object_2 = FromObject(ceiling)
code_block_2 = CodeBlock(a=string_from_object, b=string_from_object_2) { "There are" + a + "walls in the model. The total area is"+b+"square meters"; }
getInstalledVoices = Custom[DynaTalk.GetInstalledVoices]()  # Query all Windows Text-To-Speech voices installed on your machine (i.e. "Microsoft Zira Desktop"). Use one of these voices as an input to other DynaTalk nodes like "DynaTalk.VoiceName" or "DynaTalk.VoiceInfo" to get more information.
voiceName = Custom[DynaTalk.VoiceName](Voice=getInstalledVoices)  # Input Windows Text-To-Speech voices from the "DynaTalk.GetInstalledVoices" node to get their names.
boolean = BoolSelector(false)
saySomething = Custom[DynaTalk.SaySomething](Phrase=code_block_2, VoiceName=voiceName@L1, Reset=boolean)  # Let Dynamo speak! Input string or a list of strings and put on your headphones. VoiceName input is the name of the voice installed on your Windows machine. Use "DynaTalk.VoiceName" node to get the voice. Only one voice item allowed.
