# Dynamo graph Filled Region Set Line Style - Combo.dyn (Dynamo 1.3.0.875)

select_model_element = DSModelElementSelection()
categories = Categories("DetailComponents")
all_elements_of_category = ElementsOfCategory(categories)
code_block = CodeBlock { "Type"; }
getParameterValueByName = Element.GetParameterValueByName(element=all_elements_of_category, parameterName=code_block)
name = Element.Name(getParameterValueByName)
watch = Watch(getParameterValueByName)

# group: GETS THE LINE STYLE NAME FOR EVERY LINE
categories_2 = Categories("Lines")
all_elements_of_category_2 = ElementsOfCategory(categories_2)
code_block_2 = CodeBlock { "Line Style"; }
getParameterValueByName_2 = Element.GetParameterValueByName(element=all_elements_of_category_2, parameterName=code_block_2)
name_2 = Element.Name(getParameterValueByName_2)

change_from_this_line_style = CodeBlock { {"Medium Lines", "Solid - 3", "3-Solid", "xxx3-Solid", "xxxSolid - 3", "xxxxSolid - 3", "xxxxxSolid - 3", "xxxxxSolid - 3", "xxxxxxxx3-Solid"}; }

# group: DETERMINES IF THE LINE STYLE MATCHES ANY OF THE 'CHANGE FROM' STYLES
eq = name_2 == change_from_this_line_style  # lacing=CrossProduct
code_block_3 = CodeBlock { true; }
eq_2 = _ == code_block_3  # unwired: arg0
trueForAny = TrueForAny(eq, eq_2, lacing=Longest)

watch_2 = Watch(trueForAny)
watch_3 = Watch(eq)
filterByBoolMask = List.FilterByBoolMask(list=all_elements_of_category_2, mask=trueForAny)
change_to_this_line_style = CodeBlock { "3 - Solid"; }

# group: GETS ALL LINE STYLES, FILTERS DOWN TO ONLY THE 'CHANGE TO' STYLE, THEN RETRIEVES THE "GrpahicsStyle" FOR IT.
get_all_line_styles = Custom[Get All Line Styles]()  # This node will return all available line styles.
name_3 = Element.Name(get_all_line_styles)
eq_3 = change_to_this_line_style == name_3
filterByBoolMask_2 = List.FilterByBoolMask(list=get_all_line_styles, mask=eq_3)

setParameterByName = Element.SetParameterByName(element=filterByBoolMask.in, parameterName=code_block_2, value=filterByBoolMask_2.in, lacing=Longest)

# group: # at the bottom is the number of lines actually switched over.
watch_4 = Watch(setParameterByName)

# group: Select Filled Regions
select_model_elements = DSModelElementsSelection()  # 1 picked in the model

python_script = Python(IN[0]=select_model_elements)
# ---------- python_script.python (32 lines) ----------
import clr
clr.AddReference('ProtoGeometry')
from Autodesk.DesignScript.Geometry import *

# Import DocumentManager and TransactionManager
clr.AddReference("RevitServices")
import RevitServices
from RevitServices.Persistence import DocumentManager
from RevitServices.Transactions import TransactionManager

# Import RevitAPI
clr.AddReference("RevitAPI")
import Autodesk
from Autodesk.Revit.DB import *

doc = DocumentManager.Instance.CurrentDBDocument
uiapp = DocumentManager.Instance.CurrentUIApplication
app = uiapp.Application


region = UnwrapElement(IN[0])


lineIds = []

TransactionManager.Instance.EnsureInTransaction(doc)


TransactionManager.Instance.TransactionTaskDone()

#Assign your outputs to the OUT variable
OUT = GraphicStyleId(region)
# ----------------------------------------

# group: Select Filled Regions
select_model_elements_2 = DSModelElementsSelection()  # 1 picked in the model

code_block_4 = CodeBlock(a=select_model_elements_2) { {a}; }
get_all_line_styles_2 = Python()
# ---------- get_all_line_styles_2.python (24 lines) ----------
import clr
# import Document Manager
clr.AddReference("RevitServices")
import RevitServices 
from RevitServices.Persistence import DocumentManager
from RevitServices.Transactions import TransactionManager
doc = DocumentManager.Instance.CurrentDBDocument
uidoc = DocumentManager.Instance.CurrentUIDocument
clr.AddReference("RevitNodes")
import Revit
clr.ImportExtensions(Revit.Elements)
clr.ImportExtensions(Revit.GeometryConversion)
clr.AddReference("RevitAPI")
from Autodesk.Revit.DB import *


coll = FilteredElementCollector(doc).OfClass(GraphicsStyle).ToElementIds()

elements = []

for c in coll:
	elements.append(doc.GetElement(c))

OUT = elements
# ----------------------------------------
name_4 = Element.Name(get_all_line_styles_2)

# group: Set Line Style
code_block_5 = CodeBlock { "<Invisible lines>"; }

firstIndexOf = List.FirstIndexOf(list=name_4, item=code_block_5)
getItemAtIndex = List.GetItemAtIndex(list=get_all_line_styles_2, index=firstIndexOf)
python_script_2 = Python(IN[0]=code_block_4, IN[1]=getItemAtIndex)
# ---------- python_script_2.python (35 lines) ----------
import clr
clr.AddReference('ProtoGeometry')
from Autodesk.DesignScript.Geometry import *

# Import DocumentManager and TransactionManager
clr.AddReference("RevitServices")
import RevitServices
from RevitServices.Persistence import DocumentManager
from RevitServices.Transactions import TransactionManager

# Import RevitAPI
clr.AddReference("RevitAPI")
import Autodesk
from Autodesk.Revit.DB import *

doc = DocumentManager.Instance.CurrentDBDocument
uiapp = DocumentManager.Instance.CurrentUIApplication
app = uiapp.Application


region = UnwrapElement(IN[0])

ids = UnwrapElement(IN[1])

lineIds = []

TransactionManager.Instance.EnsureInTransaction(doc)

for r in region:
	lineIds.append(FilledRegion.GetBoundaries(r))

TransactionManager.Instance.TransactionTaskDone()

#Assign your outputs to the OUT variable
OUT = lineIds
# ----------------------------------------
flatten = Flatten(python_script_2)
code_block_6 = CodeBlock(a=flatten) { a[0]; }
geometry = Element.Geometry(select_model_elements)
select_model_elements_3 = DSModelElementsSelection()  # 1 picked in the model
elementFaceReferences = Element.ElementFaceReferences(select_model_elements)
code_block_7 = CodeBlock { "GraphicStyleId"; }
getParameterValueByName_3 = Element.GetParameterValueByName(element=elementFaceReferences, parameterName=code_block_7)
geometry_2 = Custom[Element.Geometry+]()  # Returns Dynamo AND native Revit geometry of a given element; unwired: element, detailLevel
python_script_3 = Python()  # unwired: IN[0], IN[1], IN[2], IN[3], IN[4], IN[5]
# ---------- python_script_3.python (73 lines) ----------
import clr
clr.AddReference('RevitAPI')
from Autodesk.Revit.DB import *

clr.AddReference("RevitNodes")
import Revit
clr.ImportExtensions(Revit.Elements)
clr.ImportExtensions(Revit.GeometryConversion)

clr.AddReference("RevitServices")
import RevitServices
from RevitServices.Persistence import DocumentManager
from RevitServices.Transactions import TransactionManager

# this function takes care of exploding 
# GeometryInstance objects. GI objects typically
# represent family instance geometry.
# in order to also catch possible nested families
# the fucntion calls itself recursively.
def convert_geometry_instance(geo, elementlist):
	for g in geo:
		if str(g.GetType()) == 'Autodesk.Revit.DB.GeometryInstance':
			elementlist = convert_geometry_instance(g.GetInstanceGeometry(), elementlist)
		else:
			try: 
				if g.Volume != 0:
					elementlist.append(g)
			except:
				pass
	return elementlist

doc = DocumentManager.Instance.CurrentDBDocument
items = UnwrapElement(IN[0])
detail_lvl = IN[1]
inc_invis = IN[2]
view = UnwrapElement(IN[3])
inserts = UnwrapElement(IN[4])
remove_inserts = IN[5]
revitlist = list()
dynlist = list()
# we might need a transaction in order to 
# temporarily delete all inserts and retrieve gross wall areas
TransactionManager.Instance.EnsureInTransaction(doc)
trans = SubTransaction(doc)
trans.Start()
i = 0
for item in items:
	if remove_inserts == True:
		for insert in inserts[i]:
			doc.Delete(insert.Id)
		doc.Regenerate()
	geo_options = Options()
	if view == None: geo_options.DetailLevel = detail_lvl
	geo_options.IncludeNonVisibleObjects = inc_invis
	if view != None: geo_options.View = view
	revitGeo = item.Geometry[geo_options]
	try:		
		revit_geos = convert_geometry_instance(revitGeo, list())
		revitlist.append(revit_geos)
		dyn_geos = list()
		for geo in revit_geos:
			try:
				dyn_geos.append(geo.ToProtoType())
			except:
				pass
		dynlist.append(dyn_geos)	
	except:
		revitlist.append(list())
		dynlist.append(list())
	i += 1
trans.RollBack()
TransactionManager.Instance.TransactionTaskDone()
OUT = (dynlist,revitlist)
# ----------------------------------------
getBuiltInParamterName = Archilab.Grimshaw.Elements.Parameter.GetBuiltInParamterName(select_model_elements)  # unwired: arg1
get_revit_activeview = Custom[Get Revit ActiveView]()  # Active View
python_script_4 = Python(IN[1]=get_revit_activeview)  # unwired: IN[0]
# ---------- python_script_4.python (22 lines) ----------
import clr
clr.AddReference('RevitAPI')
from Autodesk.Revit.DB import *

clr.AddReference("RevitNodes")
import Revit
clr.ImportExtensions(Revit.GeometryConversion)

items = UnwrapElement(IN[0])
view = UnwrapElement(IN[1])
elementlist = list()
maxlist = list()
minlist = list()

for item in items:
	try:
		elementlist.append(item.BoundingBox[view])
		maxlist.append(item.BoundingBox[view].Max.ToPoint())
		minlist.append(item.BoundingBox[view].Min.ToPoint())
	except:
		pass
OUT = (elementlist,maxlist,minlist)
# ----------------------------------------
code_block_8 = CodeBlock(a=select_model_elements) { {a}; }
code_block_9 = CodeBlock { false; }
python_script_5 = Python(IN[0]=select_model_elements, IN[1]=code_block_9, IN[2]=code_block_9)
# ---------- python_script_5.python (87 lines) ----------
#Copyright(c) 2016, Dimitar Venkov
# @5devene, dimitar.ven@gmail.com

import clr
import math

clr.AddReference("RevitServices")
import RevitServices
from RevitServices.Persistence import DocumentManager
from RevitServices.Transactions import TransactionManager
doc = DocumentManager.Instance.CurrentDBDocument

clr.AddReference("RevitNodes")
import Revit
clr.ImportExtensions(Revit.Elements)
clr.ImportExtensions(Revit.GeometryConversion)

clr.AddReference("RevitAPI")
from Autodesk.Revit.DB import *

def tolist(obj1):
	if hasattr(obj1,"__iter__"): return obj1
	else: return [obj1]

def output1(l1):
	if len(l1) == 1: return l1[0]
	else: return l1

elements = UnwrapElement(tolist(IN[0]))
getModel = IN[1]

accepted_mc = "Autodesk.Revit.DB.ModelLine, Autodesk.Revit.DB.ModelArc, Autodesk.Revit.DB.ModelEllipse, Autodesk.Revit.DB.ModelHermiteSpline, Autodesk.Revit.DB.ModelNurbSpline"

def almost_eq(line, mc):
	line2 = mc.Location.Curve
	xyz1 = line.Evaluate(0.5, True)
	if not line2.IsBound:
		xyz2 = line2.Center
		try: xyz1 = line.Center
		except: pass
	else:
		xyz2 = line2.Evaluate(0.5, True)
	if xyz1.DistanceTo(xyz2) <= 0.0001:
		return True
	else:
		return False

def clean1(l1):
	for i in xrange(len(l1)):
		l1[i] = [x for x in l1[i] if x != None]
	return l1

def getSketch(el1):
	t1 = SubTransaction(doc)
	t1.Start()
	deleted = doc.Delete(el1.Id)
	t1.RollBack()
	
	profile,mc = CurveArrArray(), []
	for d in deleted:
		test_el = doc.GetElement(d)
		el_type = test_el.GetType().ToString()
		if el_type == "Autodesk.Revit.DB.Sketch":
			profile = test_el.Profile
			if not getModel:
				break
		elif getModel and el_type in accepted_mc : mc.append(test_el)
	ordered_mc = []
	if getModel:
		ordered_mc = [[None] * i.Size for i in profile]
	curves = [[None] * i.Size for i in profile]
	for i in xrange(profile.Size):
		for j in xrange(profile[i].Size):
			curves[i][j] = profile[i][j].ToProtoType()
			if getModel:
				for k in xrange(len(mc)):
					if almost_eq(profile[i][j], mc[k]):
						ordered_mc[i][j] = mc[k].ToDSType(True)
						del mc[k]
						break
						
	return test_el, profile

TransactionManager.Instance.EnsureInTransaction(doc)
result = map(getSketch, elements)
TransactionManager.Instance.TransactionTaskDone()
OUT = result
# ----------------------------------------
flatten_2 = Flatten(python_script_5)
curves = Element.Curves(flatten_2)
python_script_6 = Python(IN[0]=select_model_elements, IN[1]=get_revit_activeview)
# ---------- python_script_6.python (63 lines) ----------
import clr
clr.AddReference('ProtoGeometry')
from Autodesk.DesignScript.Geometry import *

# Import DocumentManager and TransactionManager
clr.AddReference("RevitServices")
import RevitServices
from RevitServices.Persistence import DocumentManager
from RevitServices.Transactions import TransactionManager

# Import RevitAPI
clr.AddReference("RevitAPI")
import Autodesk
from Autodesk.Revit.DB import *

clr.AddReference("RevitNodes")
import Revit
clr.ImportExtensions(Revit.GeometryConversion)


doc = DocumentManager.Instance.CurrentDBDocument
uiapp = DocumentManager.Instance.CurrentUIApplication
app = uiapp.Application


region = UnwrapElement(IN[0])

view = UnwrapElement(IN[1])
e = []
geoElement = []
#geoElement = region.get_Geometry()
ele = doc.GetElement(region.Id)
ref = Reference(region)
geoSolid = region.GetGeometryObjectFromReference(ref)
geomOption = app.Create.NewGeometryOptions()
geomOption.View = view
geomOption.IncludeNonVisibleObjects = 0

#geometry element
geomElem = region.get_Geometry(geomOption)
#gInst = geomElem.First()
#gSymbol = gInst.GetSymbolGeometry()
#solid = Solid(geoSolid)
#face = geomElem.Faces.get_Item(0)
#elem = doc.GetElement(ref.ElementId);
#stableRefSymbol = ref.ConvertToStableRepresentation(doc)
#geomElem = elem.get_Geometry(geomOption)
enum1 = geomElem.GetEnumerator() ; enum1.MoveNext()
geo2 = enum1.Current

#geoInst = geo2.GetSymbolGeometry()

face = geo2.Faces
edgeArray = geo2.Edges

lineStyles = []

for edge in edgeArray:
	lineStyles.append(edge.GraphicsStyleId)


#Assign your outputs to the OUT variable
OUT = lineStyles, edgeArray
# ----------------------------------------
code_block_10 = CodeBlock(a=python_script_6) { a[3][1]; }
curve = CurveElement.Curve(code_block_10)
code_block_11 = CodeBlock(a=python_script_6) { a[2][0]; }
elementCurveReferences = Element.ElementCurveReferences(code_block_11)
