# Dynamo graph GRID FROM CAD ALIGNMENT-05.dyn (Dynamo 2.0.1.5055)

coordinateSystemAtParameter = Curve.CoordinateSystemAtParameter()  # unwired: curve

# group: select imported DWG
select_model_element = DSModelElementSelection()  # 1 picked in the model
geometry = Element.Geometry(element=select_model_element)

number = DoubleInput(0)
length = Curve.Length(curve=geometry)

# group: Chainage length you want to create (place number in code block in middle)(round to whole number. i.e 2,3,5,10)
code_block = CodeBlock { 16000; }

code_block_2 = CodeBlock(length=length, chainLength=code_block) { length/chainLength; }
floor = Math.Floor(number=code_block_2)
code_block_3 = CodeBlock { 1; }
add = floor + code_block_3
sequence = Sequence(start=number, amount=add, step=code_block)
parameterAtSegmentLength = Curve.ParameterAtSegmentLength(curve=geometry, segmentLength=sequence, lacing=Longest)
pointAtParameter = Curve.PointAtParameter(curve=geometry, param=parameterAtSegmentLength)
code_block_4 = CodeBlock(pt=pointAtParameter) { Point.ByCoordinates(pt.X,pt.Y,0); }
horizontalFrameAtParameter = Curve.HorizontalFrameAtParameter(curve=geometry, param=parameterAtSegmentLength)
XAxis = CoordinateSystem.XAxis(coordinateSystem=horizontalFrameAtParameter)
code_block_5 = CodeBlock(v=XAxis) { Vector.ByCoordinates(v.X,v.Y,0); }

# group: grid line length
code_block_6 = CodeBlock { 10000; }

byStartPointDirectionLength = Line.ByStartPointDirectionLength(startPoint=code_block_4, direction=code_block_5, length=code_block_6)
code_block_7 = CodeBlock(totallength=code_block_6) { -totallength/2; }
translate = Geometry.Translate(geometry=byStartPointDirectionLength, distance=code_block_7)  # unwired: direction
byCurve = ModelCurve.ByCurve(curve=translate)  # frozen
code_block_8 = CodeBlock { 500; }

# group: Change 'Number' to chainage length. (i.e 2,3,5,10)
number_2 = DoubleInput(0.001)
mul = sequence * number_2
add_2 = mul + code_block_8

code_block_9 = CodeBlock(n=add_2) { Math.Round(n,2)[0]; }
string_from_object_python = Python(IN[0]=code_block_9)
# ---------- string_from_object_python.python (3 lines) ----------
names = IN[0]

OUT = [str(n).rstrip('0').rstrip('.') for n in names]
# ----------------------------------------

# group: connect this to value in Element.SetParameterByName above if you need to reverse the chainages
reverse = List.Reverse(list=string_from_object_python)

# group: Create grid in Revit
byLine = Grid.ByLine(line=translate)

flatten = List.Flatten(list=byLine)
code_block_10 = CodeBlock { "Name"; }
string = StringInput("G")
getParameterValueByName = Element.GetParameterValueByName(element=flatten, parameterName=code_block_10)
add_3 = string + getParameterValueByName
setParameterByName = Element.SetParameterByName(element=flatten, parameterName=code_block_10, value=add_3)
code_block_11 = CodeBlock { "m"; }
add_4 = string_from_object_python + code_block_11
setParameterByName_2 = Element.SetParameterByName(element=setParameterByName, parameterName=code_block_10, value=add_4)
normalAtParameter = Curve.NormalAtParameter()  # unwired: curve
code_block_12 = CodeBlock { 90; }
rotate = Vector.Rotate(vector=XAxis, degrees=code_block_12)  # unwired: axis
