# Dynamo graph GSaGWACommand.dyn (Dynamo 2.0.0.3911)

code_block = CodeBlock { "GET,NODE"; }
code_block_2 = CodeBlock { 1..10; }
gwaCommand = ReadGsa.Core.GwaCommand(arg1=code_block, arg2=code_block_2)  # unwired: arg0
file_path = Filename("..\Desktop\gsa101.gwb")
openGsaFile = ReadGsa.Core.OpenGsaFile(file_path)
code_block_3 = CodeBlock { "all"; }
elements = ReadGsa.GSAElements.Elements(openGsaFile, code_block_3)
code_block_4 = CodeBlock { "SET_AT,LOAD_2D_FACE,2,1,LOCAL,CONS,NO,Z"; }
string = StringInput("NODE,5,cioa, 2, 1000, 450, 800\n")
code_block_5 = CodeBlock { "SET"; }
openGsaFile_2 = ReadGsa.Core.OpenGsaFile(file_path)
string_2 = StringInput("SET, NODE, 25, 10, 4.5")
code_block_6 = CodeBlock { 8; }
gwaCommand_2 = ReadGsa.Core.GwaCommand(openGsaFile, string_2, code_block_6)
string_3 = StringInput("SET, POLYLINE_2D,3,2D Polyline,2,\"(0,5) (5,5)\"")
string_4 = StringInput("SET,LOAD_2D_FACE,2,1,LOCAL,CONS,NO,Z,-50000;")
code_block_7 = CodeBlock { "GET,NODE,2"; }
writeGsaFile = WriteGsa.Core.WriteGsaFile(file_path)
string_5 = StringInput("SET,SEC_BEAM,10,Section A,STEEL,STD%R%500.%50.,NA,0")
string_6 = StringInput("NODE,20,1000,1000,1000,1000,1000")
gwaCommandFromString = ReadGsa.Core.GwaCommandFromString(openGsaFile, string_6)
