# Dynamo graph Geometry.dyn (Dynamo 1.3.1.1736)

teta = CodeBlock { -Math.PI/2..Math.PI/2..#10; }
phi = CodeBlock { 0..Math.PI..#10; }
formula = Formula("cos(teta)*cos(phi)", teta=teta, phi=phi, lacing=CrossProduct)
formula_2 = Formula("cos(teta)*sin(phi)", teta=teta, phi=phi, lacing=CrossProduct)
formula_3 = Formula("sin(teta)", teta=teta, lacing=CrossProduct)
byCoordinates = Point.ByCoordinates(x=formula, y=formula_2, z=formula_3)
code_block = CodeBlock { 0..90..#10; }
code_block_2 = CodeBlock { 0..180..#10; }
python_script = Python(IN[0]=code_block, IN[1]=code_block_2)
# ---------- python_script.python (24 lines) ----------
import clr
clr.AddReference('ProtoGeometry')
from Autodesk.DesignScript.Geometry import *
import math
#The inputs to this node will be stored as a list in the IN variables.
teta = IN[0]
phi = IN[1]

x = []
y = []
z = []

for t in teta:
	for p in phi:
		x.append(math.cos(t)*math.cos(p))
		y.append(math.cos(t)*math.sin(p))
		z.append(math.sin(t))

pt = []
for i in range(0,len(x)):
	pt.append(Point.ByCoordinates(x[i],y[i],z[i]))

#Assign your output to the OUT variable.
OUT = x,y,z,pt
# ----------------------------------------
code_block_3 = CodeBlock(a=python_script) { a[0]; a[1]; a[2]; }
byCoordinates_2 = Point.ByCoordinates(x=code_block_3.out0, y=code_block_3.out1, z=code_block_3.out2)
code_block_4 = CodeBlock()
# ---------- code_block_4.designscript (9 lines) ----------
def sample_trig(npoints:int[]..[],theta:int[]..[],phi:int[]..[])
{

    x = Math.Cos(theta) * Math.Cos(phi);
    y = Math.Cos(theta) * Math.Sin(phi);
    z = Math.Sin(theta);
    return = {x,y,z};

};
# ----------------------------------------
phi_2 = CodeBlock { 0..Math.PI..#10; }
teta_2 = CodeBlock { -Math.PI/2..Math.PI/2..#10; }
code_block_5 = CodeBlock { 1; }
python_script_2 = Python(IN[0]=phi_2, IN[1]=teta_2, IN[2]=code_block_5)
# ---------- python_script_2.python (32 lines) ----------
import clr
import math
clr.AddReference('ProtoGeometry')
from Autodesk.DesignScript.Geometry import *
#The inputs to this node will be stored as a list in the IN variables.
fi = IN[0]
teta = IN[1]
R = IN[2]

x = []
y = []
z = []

for f in fi:
	for t in teta:
		x.append(R*(math.cos(t)*math.cos(f)))
		y.append(R*(math.cos(t)*math.sin(f)))
		z.append(R*(math.sin(t)))

"""
for t in teta:
	z.append(R*(math.sin(t)))
"""
"""
for i in range(0,len(fi)):
	for j in range(0,len(teta)):
		x.append(math.cos(fi[i])*math.cos(teta[j]))
		y.append(math.cos(teta[j])*math.sin(fi[i]))
		z.append(math.sin(teta[j]))
		"""
#Assign your output to the OUT variable.
OUT = x,y,z
# ----------------------------------------
code_block_6 = CodeBlock(a=python_script_2) { a[0]; a[1]; a[2]; }
byCoordinates_3 = Point.ByCoordinates(x=code_block_6.out0, y=code_block_6.out1, z=code_block_6.out2)
code_block_7 = CodeBlock { 10; }
cycle = List.Cycle(list=code_block_7, amount=code_block_7)
code_block_8 = CodeBlock(a=cycle, theta=teta, phi=phi) { sample_trig(a<2>,theta,phi); }
code_block_9 = CodeBlock { 0; }
getItemAtIndex = List.GetItemAtIndex(list=code_block_8@L4, index=code_block_9, lacing=Longest)
code_block_10 = CodeBlock { 1; }
getItemAtIndex_2 = List.GetItemAtIndex(list=code_block_8@L4, index=code_block_10, lacing=Longest)
code_block_11 = CodeBlock { 2; }
getItemAtIndex_3 = List.GetItemAtIndex(list=code_block_8@L4, index=code_block_11, lacing=Longest)
byCoordinates_4 = Point.ByCoordinates(x=getItemAtIndex, y=getItemAtIndex_2, z=getItemAtIndex_3)
code_block_12 = CodeBlock { 1..5; }
code_block_13 = CodeBlock { 6..10; }
mul = code_block_12 * code_block_13  # lacing=CrossProduct
python_script_3 = Python(IN[0]=code_block_12, IN[1]=code_block_13)
# ---------- python_script_3.python (18 lines) ----------
import clr
import math
clr.AddReference('ProtoGeometry')
from Autodesk.DesignScript.Geometry import *
#The inputs to this node will be stored as a list in the IN variables.
first = IN[0]
second = IN[1]

ot = []

for t in first:
	for s in second:
		ot.append(t*s)



#Assign your output to the OUT variable.
OUT = ot
# ----------------------------------------
python_script_4 = Python(IN[0]=code_block_12, IN[1]=code_block_13)
# ---------- python_script_4.python (16 lines) ----------
import clr
import math
clr.AddReference('ProtoGeometry')
from Autodesk.DesignScript.Geometry import *
#The inputs to this node will be stored as a list in the IN variables.
first = IN[0]
second = IN[1]

ot = []

for i in range(0,len(first)):
	for j in range(0,len(second)):
		ot.append(first[i]*second[j])

#Assign your output to the OUT variable.
OUT = ot
# ----------------------------------------
