# Dynamo graph HandOrientation.dyn (Dynamo 2.1.0.6255)

select_model_element = DSModelElementSelection()  # 1 picked in the model
python_script = Python(IN[0]=select_model_element)
# ---------- python_script.python (32 lines) ----------
import clr

clr.AddReference('RevitAPI')
from Autodesk.Revit.DB import *
from Autodesk.Revit.DB.Structure import *

clr.AddReference('RevitAPIUI')
from Autodesk.Revit.UI import *

clr.AddReference('System')
from System.Collections.Generic import List

clr.AddReference('RevitNodes')
import Revit
clr.ImportExtensions(Revit.GeometryConversion)
clr.ImportExtensions(Revit.Elements)

clr.AddReference('RevitServices')
import RevitServices
from RevitServices.Persistence import DocumentManager
from RevitServices.Transactions import TransactionManager

doc = DocumentManager.Instance.CurrentDBDocument
uidoc=DocumentManager.Instance.CurrentUIApplication.ActiveUIDocument

#Preparing input from dynamo to revit
e = UnwrapElement(IN[0])




OUT = e.HandOrientation.ToVector(), e.GetTransform().Origin.ToPoint()
# ----------------------------------------
code_block = CodeBlock(a=python_script) { a[0]; a[1]; }
code_block_2 = CodeBlock { 1000; }
byStartPointDirectionLength = Line.ByStartPointDirectionLength(startPoint=code_block.out1, direction=code_block.out0, length=code_block_2)
byCurve = ModelCurve.ByCurve(curve=byStartPointDirectionLength)
