# Dynamo graph Loft01.dyn (Dynamo 2.0.2.6826)

code_block = CodeBlock { a[0]; }  # unwired: a
curves = PolyCurve.Curves(polyCurve=code_block)
code_block_2 = CodeBlock { 0..1; }
pointAtParameter = Curve.PointAtParameter(curve=curves, param=code_block_2, lacing=CrossProduct)
code_block_3 = CodeBlock { 10000; }
parameterAtSegmentLength = Curve.ParameterAtSegmentLength(curve=curves, segmentLength=code_block_3)
horizontalFrameAtParameter = Curve.HorizontalFrameAtParameter(curve=curves, param=parameterAtSegmentLength)
origin = CoordinateSystem.Origin(coordinateSystem=horizontalFrameAtParameter)
code_block_4 = CodeBlock { 200; }
byCenterPointRadius = Circle.ByCenterPointRadius(centerPoint=origin, radius=code_block_4)
select_model_element = DSModelElementSelection()  # 1 picked in the model
geometry = Element.Geometry(element=select_model_element)
code_block_5 = CodeBlock(a=geometry) { a[155..514]; }
curves_2 = PolyCurve.Curves(polyCurve=code_block_5)
flatten = List.Flatten(list=curves_2)
byCurve = ModelCurve.ByCurve(curve=flatten)
byJoinedCurves = PolyCurve.ByJoinedCurves()  # unwired: curves
byCurve_2 = ModelCurve.ByCurve(curve=geometry)
