# Dynamo graph Loft02.dyn (Dynamo 1.3.3.4651)

number_slider = DoubleSlider(0.5, range=0..100 step 0.1)
byCenterPointRadius = Circle.ByCenterPointRadius(radius=number_slider)
number = DoubleInput(0)

# group: Distance between points [m]
number_2 = DoubleInput(10)

number_3 = DoubleInput(1)
number_4 = DoubleInput(0)
select_model_element = DSModelElementSelection()  # 1 picked in the model
geometry = Element.Geometry(select_model_element)
explode = Geometry.Explode(geometry)

# group: Create a new from each PolyCurve's curve start point
number_5 = DoubleInput(3)
byPoints = NurbsCurve.ByPoints(arg1=number_5)  # unwired: arg0
number_6 = DoubleInput(0)
planeAtParameter = Curve.PlaneAtParameter(curve=explode, param=number_6)
origin = Plane.Origin(planeAtParameter)

length = Curve.Length(byPoints)
div = length / number_2
floor = Math.Floor(div)
add = floor + number_3
sequence = Sequence(start=number, amount=add, step=number_2, lacing=Longest)
parameterAtSegmentLength = Curve.ParameterAtSegmentLength(byPoints, sequence, lacing=Longest)
planeAtParameter_2 = Curve.PlaneAtParameter(curve=byPoints, param=parameterAtSegmentLength)
byPlane = CoordinateSystem.ByPlane(planeAtParameter_2, lacing=Longest)
transform = Geometry.Transform(byCenterPointRadius, byPlane)
getItemAtIndex = List.GetItemAtIndex(list=transform, index=number_4)
number_7 = DoubleInput(0)
getItemAtIndex_2 = List.GetItemAtIndex(list=explode, index=number_7)
sweepAsSolid = Curve.SweepAsSolid(getItemAtIndex, getItemAtIndex_2)  # frozen
byGeometry = Custom[Springs.BrepShape.ByGeometry]()  # Convert the input geometry to DirectShape element inside the Revit document. Works only in Revit 2017 and later. Usies the more advanced BrepBuilder. It supports solids or surfaces, however periodic faces like spheres, cylinders and cones are not supported. Each created DS will have a unique type. Make sure that each input geometry has a unique name. You can either feed a single category and material for all geometries or a unique one for each geometry - the node's lacing is set to longest by default. The default category is Generic Model.; unwired: geometry, name
python_script = Python()  # unwired: IN[0], IN[1], IN[2], IN[3]
# ---------- python_script.python (156 lines) ----------
# Copyright(c) 2017, Dimitar Venkov
# @5devene, dimitar.ven@gmail.com
# www.badmonkeys.net

import clr
import System
from itertools import repeat

pf_path = System.Environment.GetFolderPath(System.Environment.SpecialFolder.ProgramFilesX86)
import sys
sys.path.append("%s\IronPython 2.7\Lib" %pf_path)
import traceback

clr.AddReference('ProtoGeometry')
from Autodesk.DesignScript.Geometry import *

clr.AddReference("RevitServices")
from RevitServices.Persistence import DocumentManager
from RevitServices.Transactions import TransactionManager
doc = DocumentManager.Instance.CurrentDBDocument

clr.AddReference("RevitNodes")
import Revit
clr.ImportExtensions(Revit.Elements)
clr.ImportExtensions(Revit.GeometryConversion)

clr.AddReference("RevitAPI")
import Autodesk.Revit.DB as RVT

def tolist(obj1):
	if hasattr(obj1,"__iter__"): return obj1
	else: return [obj1]

def PadLists(lists):
	len1 = len(lists[0])
	for i in xrange(1,len(lists)):
		len2 = len(lists[i])
		if len2 == len1 : continue
		elif len2 > len1: lists[i] = lists[i][:len1]
		else : lists[i].extend(repeat(lists[i][-1],len1 - len2))
	return lists

def NewDS_R17(geom1, cat1, name1, mat1): 
	toDispose = []
	try:
		edg_enum = dict()
		faces = geom1.Faces
		br1 = RVT.BRepBuilder(RVT.BRepType.OpenShell)
		toDispose.append(br1)
		for f in faces:
			s1 = f.SurfaceGeometry()
			toDispose.append(s1)
			isPlanar = Curve.ByParameterLineOnSurface(s1, UV.ByCoordinates(0,0),
					UV.ByCoordinates(1,1) ).IsPlanar
			if isPlanar:
				o1 = s1.PointAtParameter(0.5,0.5).ToXyz(True)
				v1 = s1.NormalAtParameter(0.5,0.5).ToXyz(True)
				sf1 = RVT.BRepBuilderSurfaceGeometry.Create(RVT.Plane.
						CreateByNormalAndOrigin(v1, o1), None)
				isFlipped = False
			else:
				ns1 = s1.ToNurbsSurface()
				toDispose.append(ns1)
				isFlipped = s1.NormalAtParameter(0.5, 0.5).Dot(ns1.
					NormalAtParameter(0.5, 0.5) ) < 0
				pts1 = [j.ToXyz(True) for i in ns1.ControlPoints() for j in i ]
				sf1 = RVT.BRepBuilderSurfaceGeometry.CreateNURBSSurface(ns1.DegreeU,
					ns1.DegreeV, ns1.UKnots(), ns1.VKnots(), pts1, False, None)
			toDispose.append(sf1)
			sfId = br1.AddFace(sf1, isFlipped)
			if mat1 is not None:
				br1.SetFaceMaterialId(sfId, mat1.Id)
			for lp in f.Loops:
				lp1 = br1.AddLoop(sfId)
				for ce in lp.CoEdges:
					edg = ce.Edge
					if edg in edg_enum:
						eId = edg_enum[edg]
					else:
						c0 = edg.CurveGeometry
						toDispose.append(c0)
						try:
							c1 = c0.ToRevitType(True)
						except:
							n = len(c0.ToNurbsCurve().ControlPoints() )
							pts = [c0.PointAtParameter(1.0/n * j) for j in xrange(n + 1)]
							toDispose.extend(pts)
							c1 = NurbsCurve.ByPoints(pts).ToRevitType(True)
						toDispose.append(c1)
						e1 = RVT.BRepBuilderEdgeGeometry.Create(c1)
						toDispose.append(e1)
						eId = br1.AddEdge(e1)
						edg_enum.Add(edg, eId)
					br1.AddCoEdge(lp1, eId, ce.Reversed)
			br1.FinishLoop(lp1)
			br1.FinishFace(sfId)
		result = br1.Finish()
		if result == RVT.BRepBuilderOutcome.Success:
			if cat1 is None or not RVT.DirectShape.IsValidCategoryId(cat1.Id, doc):
				cat1Id = RVT.ElementId(RVT.BuiltInCategory.OST_GenericModel)
			else:
				cat1Id = cat1.Id
			if name1 in dst_enum: #definition exists
				old_type = dst_enum[name1]
				old_type.SetShape(br1)
				fec1 = RVT.FilteredElementCollector(doc).OfClass(RVT.DirectShape).WhereElementIsNotElementType()
				insts = [i for i in fec1 if i.GetTypeId().Equals(old_type.Id)]
				if insts:
					ds1 = insts[0]
				else:
					dsLib.AddDefinitionType(name1, old_type.Id)
					ds1 = RVT.DirectShape.CreateElementInstance(doc, old_type.Id, cat1Id, name1, tf1)
					ds1.SetTypeId(old_type.Id)
			else:
				dsType1 = RVT.DirectShapeType.Create(doc, name1, cat1Id)
				dsType1.SetShape(br1)
				dsLib.AddDefinitionType(name1, dsType1.Id)
				ds1 = RVT.DirectShape.CreateElementInstance(doc, dsType1.Id, cat1Id, name1, tf1)
				ds1.SetTypeId(dsType1.Id)
			
			return ueWrapper.Invoke(None, (ds1, False) )
		else:
			return result
	except:
		return traceback.format_exc()
	finally:
		for i in toDispose: i.Dispose()

solids = tolist(IN[0])
cat = tolist(IN[1])
cat = [UnwrapElement(c) for c in cat]
names = tolist(IN[2])
mat = tolist(IN[3])
mat = [UnwrapElement(m) for m in mat]

dsLib = RVT.DirectShapeLibrary.GetDirectShapeLibrary(doc)
tf1 = RVT.Transform.Identity

dst_fec = RVT.FilteredElementCollector(doc).OfClass(RVT.DirectShapeType)
dst_enum = dict([(RVT.Element.Name.__get__(i), i) for i in dst_fec])

ueWrapper = None
wrappers = clr.GetClrType(Revit.Elements.ElementWrapper).GetMethods()
for w in wrappers:
	if w.ToString().startswith("Revit.Elements.UnknownElement"):
		ueWrapper = w
		break

if len(solids) == len(names):
	if not len(solids) == len(cat) == len(mat):
		padded = PadLists([solids, cat, mat])
		cat, mat = padded[1:]
	TransactionManager.Instance.EnsureInTransaction(doc)
	OUT = map(NewDS_R17, solids, cat, names, mat)
	TransactionManager.Instance.TransactionTaskDone()
else : OUT = "Make sure that each geometry\nobject has a unique type name."
# ----------------------------------------
sweepAsSurface = Curve.SweepAsSurface(getItemAtIndex, getItemAtIndex_2)  # frozen
byJoinedSurfaces = PolySurface.ByJoinedSurfaces(sweepAsSurface)
categories = Categories("GenericModel")
byGeometry_2 = DirectShape.ByGeometry(geometry=byJoinedSurfaces, category=categories)
string = StringInput("Test")
byGeometry_3 = Custom[Springs.DirectShape.ByGeometry](geometry=byJoinedSurfaces, category=categories, name=string)  # frozen; Convert the input geometry to DirectShape element inside the Revit document. It supports solids or surfaces. It is based on an alternative process that uses a SAT import and can produce smooth surfaces. Each created DS will have a unique type. Make sure that each input geometry has a unique name. You can either feed a single category for all geometries or a unique category for each geometry - the node's lacing is set to longest by default. The default category is Generic Models.
byPoints_2 = NurbsCurve.ByPoints(origin)
views = Views("Level 1")
origin_2 = Plane.Origin(byPlane)
number_8 = DoubleInput(1)
count = Count(byPlane, lacing=Longest)
sequence_2 = Sequence(start=number_8, amount=count, step=number_8, lacing=Longest)
string_from_object = FromObject(sequence_2)
string_2 = StringInput("Middle")
element_types = ElementTypes("TextNoteType")
all_elements_of_type = ElementsOfType(element_types)
number_9 = DoubleInput(0)
getItemAtIndex_3 = List.GetItemAtIndex(list=all_elements_of_type, index=number_9)
byLocation = TextNote.ByLocation(view=views, location=origin_2, text=string_from_object, alignment=string_2, type=getItemAtIndex_3)
flatten = Flatten(explode)
