# Dynamo custom node M-N Diagram.dyf (Dynamo 1.3.1.1736)
# category: Calcs

Concrete_Grade = Input()
Steel_Grade = Input()
Es = Input()
b = Input()
H = Input()
Top_Cover = Input()
d = Input()
python_script = Python(IN[0]=Concrete_Grade, IN[1]=Steel_Grade, IN[2]=Es, IN[3]=b, IN[4]=H, IN[5]=Top_Cover, IN[6]=d)
# ---------- python_script.python (127 lines) ----------
import clr
clr.AddReference('ProtoGeometry')
from Autodesk.DesignScript.Geometry import *
#The inputs to this node will be stored as a list in the IN variables.
#import json
import math

import sys
sys.path.append("C:\pyTest\pysection")
import shape
import material
import section
import slab
import bisect

def dump_json(obj,indent=None):
    return json.dumps(obj, default=lambda o: o.__dict__,indent=indent)

def test_rect_section():
    #create materials
    conc = material.Concrete(IN[0])
    steel = material.Steel(IN[1],IN[2])

    #define profile
    profile = shape.Rectangle(IN[3],IN[4])
    bars = [
        section.Bar(steel,section.Bar.diam_20M,IN[5]),
        section.Bar(steel,section.Bar.diam_20M,IN[5]),
        section.Bar(steel,section.Bar.diam_20M,IN[5]),
        section.Bar(steel,section.Bar.diam_20M,IN[5]),
        section.Bar(steel,section.Bar.diam_30M,IN[6]),
        section.Bar(steel,section.Bar.diam_30M,IN[6]),
        section.Bar(steel,section.Bar.diam_30M,IN[6]),
        section.Bar(steel,section.Bar.diam_30M,IN[6])]
    sec = section.Section(conc,profile,bars)

    #set material factors
    sec.concrete_factor = 0.65
    sec.steel_factor = 0.85

    #calc peak axial strength
    #print(sec.calc_peak_axial_strength())

    #print MN Chart
    file = open('C:\pyTest\pysection\mn.csv', 'w')
    Mvalues = []
    Nvalues = []
	
    for M,N in sec.calc_M_N().entries:
    	Mvalues.append(M)
    	Nvalues.append(N)
        file.write(str(M) + "," + str(N) + "\n")
        
    return Mvalues,Nvalues





def test_materials():
    print(dump_json(conc))
    print()

    print("Hognestad")
    print(conc.calc_stress_hognestad(-0.0040))
    print(conc.calc_stress_hognestad(-0.0030))
    print(conc.calc_stress_hognestad(-0.0020))
    print(conc.calc_stress_hognestad(-0.0010))
    print(conc.calc_stress_hognestad( 0.0000))
    print(conc.calc_stress_hognestad( 0.0010))
    print(conc.calc_stress_hognestad( 0.0020))
    print(conc.calc_stress_hognestad( 0.0030))
    print()

    print("Popovics NSC")
    print(conc.calc_stress_popovics_nsc(-0.0040))
    print(conc.calc_stress_popovics_nsc(-0.0030))
    print(conc.calc_stress_popovics_nsc(-0.0020))
    print(conc.calc_stress_popovics_nsc(-0.0010))
    print(conc.calc_stress_popovics_nsc( 0.0000))
    print(conc.calc_stress_popovics_nsc( 0.0010))
    print(conc.calc_stress_popovics_nsc( 0.0020))
    print(conc.calc_stress_popovics_nsc( 0.0030))
    print()

    print("Popovics HSC")
    print(conc.calc_stress_popovics_hsc(-0.0040))
    print(conc.calc_stress_popovics_hsc(-0.0030))
    print(conc.calc_stress_popovics_hsc(-0.0020))
    print(conc.calc_stress_popovics_hsc(-0.0010))
    print(conc.calc_stress_popovics_hsc( 0.0000))
    print(conc.calc_stress_popovics_hsc( 0.0010))
    print(conc.calc_stress_popovics_hsc( 0.0020))
    print(conc.calc_stress_popovics_hsc( 0.0030))
    print()

    print("Hoshikuma")
    print(conc.calc_stress_hoshikuma(-0.0040))
    print(conc.calc_stress_hoshikuma(-0.0030))
    print(conc.calc_stress_hoshikuma(-0.0020))
    print(conc.calc_stress_hoshikuma(-0.0010))
    print(conc.calc_stress_hoshikuma( 0.0000))
    print(conc.calc_stress_hoshikuma( 0.0010))
    print(conc.calc_stress_hoshikuma( 0.0020))
    print(conc.calc_stress_hoshikuma( 0.0030))
    print()

    print(dump_json(steel))
    print()

    print(steel.calc_stress(-0.0020))
    print(steel.calc_stress(-0.0010))
    print(steel.calc_stress( 0.0000))
    print(steel.calc_stress( 0.0000))
    print(steel.calc_stress( 0.0010))
    print(steel.calc_stress( 0.0020))
    print(steel.calc_stress( 0.0030))
    print(steel.calc_stress( 0.0040))
    print(steel.calc_stress( 0.0050))
    print(steel.calc_stress( 0.0060))
    print(steel.calc_stress( 0.0070))
    print(steel.calc_stress( 0.0080))
    print()


#Assign your output to the OUT variable.
OUT = test_rect_section()
# ----------------------------------------
code_block = CodeBlock(a=python_script) { a[0]; }
code_block_2 = CodeBlock(a=python_script) { a[1]; }
# note: N divided by 10 for graphic scale reasons
code_block_3 = CodeBlock(a=code_block_2) { -a/10; }
byCoordinates = Point.ByCoordinates(x=code_block, y=code_block_3)
byControlPoints = NurbsCurve.ByControlPoints(byCoordinates)
M = Output(code_block)
N = Output(code_block_3)
