# Dynamo graph PDFlink01.dyn (Dynamo 1.3.1.1736)

# group: drawing to find
code_block = CodeBlock { {600,601,602,630,660}; }

string_from_object = FromObject(code_block)
code_block_2 = CodeBlock(a=string_from_object) { "S-"+a; }
family_types = FamilyTypes("Arup_Rev Issue Box_BS1192_v1:Revision Data")
all_elements_of_family_type = ElementsOfFamilyType(family_types)
deconstruct = List.Deconstruct(list=all_elements_of_family_type)
ownerView = Custom[Element.OwnerView](element=deconstruct.rest)  # Gets the owner view of a given Revit element (if possible)
sheetNumber = Sheet.SheetNumber(ownerView)
categories = Categories("Sheets")
all_elements_of_category = ElementsOfCategory(categories)
sheetNumber_2 = Sheet.SheetNumber(all_elements_of_category)

# group: series to find
code_block_3 = CodeBlock { "S-2"; }

contains = String.Contains(str=sheetNumber_2, searchFor=code_block_3)
filterByBoolMask = List.FilterByBoolMask(list=sheetNumber_2, mask=contains)
code_block_4 = CodeBlock(a=filterByBoolMask.in) { a; }
allIndicesOf = List.AllIndicesOf(list=sheetNumber, item=code_block_4)
getItemAtIndex = List.GetItemAtIndex(list=deconstruct.rest, index=allIndicesOf)
code_block_5 = CodeBlock { "PDF Link"; }
string = StringInput("\\Global.arup.com\london\BEL\Jobs\200000\235900\235972-00 Wedge House\4 Internal Data\01 Outgoing Documents Register")
code_block_6 = CodeBlock(a=code_block_4) { "*"+a+"*.pdf"; }
contents = Custom[Directory.Contents+](directoryPath=string, searchString=code_block_6)  # Unlike the built-in node Directory.Contents, this node browses a directory recursively and returns all relevant files contained in subfolders as well.
get_date_modified_from_file_path = Custom[Get Date Modified From File Path List](filePathList=contents, lacing=Longest)  # list of paths to files
string_from_object_2 = FromObject(get_date_modified_from_file_path)
fromString = DateTime.FromString(string_from_object_2)
code_block_7 = CodeBlock { "yyyy-MM-dd"; }

# group: pdf date
format = DateTime.Format(fromString, code_block_7)

code_block_8 = CodeBlock { "Date"; }
getParameterValueByName = Element.GetParameterValueByName(element=getItemAtIndex, parameterName=code_block_8)
code_block_9 = CodeBlock(a=getParameterValueByName) { a; }
code_block_10 = CodeBlock { "."; }
split = String.Split(code_block_9@L2, code_block_10)
code_block_11 = CodeBlock { 2; }
getItemAtIndex_2 = List.GetItemAtIndex(list=split@@L2, index=code_block_11, lacing=Longest)
code_block_12 = CodeBlock(year=getItemAtIndex_2) { "20"+year; }
toNumber = String.ToNumber(code_block_12)
code_block_13 = CodeBlock { 1; }
getItemAtIndex_3 = List.GetItemAtIndex(list=split@@L2, index=code_block_13, lacing=Longest)
toNumber_2 = String.ToNumber(getItemAtIndex_3)
code_block_14 = CodeBlock { 0; }
getItemAtIndex_4 = List.GetItemAtIndex(list=split@@L2, index=code_block_14, lacing=Longest)
toNumber_3 = String.ToNumber(getItemAtIndex_4)
byDate = DateTime.ByDate(toNumber, toNumber_2, toNumber_3, lacing=Longest)

# group: revision date
format_2 = DateTime.Format(byDate, code_block_7)

allIndicesOf_2 = List.AllIndicesOf(list=format@L2, item=format_2, lacing=Longest)
isEmpty = List.IsEmpty(allIndicesOf_2@@L2, lacing=Longest)
code_block_15 = CodeBlock { 9; }
get_characters_at_start_of = Custom[Get Characters at Start of Strings](listOfStrings=format, charactersToKeep=code_block_15)
get_characters_at_start_of_2 = Custom[Get Characters at Start of Strings](listOfStrings=format_2, charactersToKeep=code_block_15)
allIndicesOf_3 = List.AllIndicesOf(list=get_characters_at_start_of@L2, item=get_characters_at_start_of_2, lacing=Longest)
code_block_16 = CodeBlock { 0; }
getItemAtIndex_5 = List.GetItemAtIndex(list=allIndicesOf_3@@L2, index=code_block_16, lacing=Longest)
code_block_17 = CodeBlock { 0; }
getItemAtIndex_6 = List.GetItemAtIndex(list=allIndicesOf_2@@L2, index=code_block_17, lacing=Longest)
if_ = If(test=isEmpty, true=getItemAtIndex_5, false=getItemAtIndex_6)
getItemAtIndex_7 = List.GetItemAtIndex(list=contents@@L2, index=if_, lacing=Longest)

# group: write data to revit
setParameterByName = Element.SetParameterByName(element=getItemAtIndex, parameterName=code_block_5, value=getItemAtIndex_7)
