# Dynamo graph PWG Type Maker02.dyn (Dynamo 2.0.1.5055)

family_types = FamilyTypes(index=1)
file_path = Filename(".\Cross Sectional Area Calc_WIP.xlsx")
file_from_path = FileObject(path=file_path)
code_block = CodeBlock { "MASTER"; }
boolean = BoolSelector(true)
importExcel = Data.ImportExcel(file=file_from_path, sheetName=code_block, readAsStrings=boolean)
code_block_2 = CodeBlock { 0; }
removeItemAtIndex = List.RemoveItemAtIndex(list=importExcel, indices=code_block_2)

# group: PWG's diff
python_script = Python(IN[0]=removeItemAtIndex)
# ---------- python_script.python (28 lines) ----------
data = IN[0]

result = []

for d in data:
	subresult = []
	result.append(subresult)
	if d[1] == d[2]:
		width = d[1]
	else:
		width = "("+d[1]+"/"+d[2]+")"	
	if d[3] == d[4]:
		thickness = d[3]
	else:
		thickness = "("+d[3]+"/"+d[4]+")"	
	
	#result.append("=")
	subresult.append(d[0]+"x"+width+"x"+thickness+"x"+d[5]+" PWG")
	subresult.append(int(d[0])/10)
	subresult.append(int(d[1])/10)
	subresult.append(int(d[2])/10.0)
	subresult.append(int(d[3])/10.0)
	subresult.append(int(d[4])/10.0)
	subresult.append(int(d[5])/10.0)
	subresult.append(float(d[8])/100.0)
	
# Assign your output to the OUT variable.
OUT = result 
# ----------------------------------------

deconstruct = List.Deconstruct(list=python_script, lacing=Longest)
python_script_2 = Python(IN[0]=family_types, IN[1]=deconstruct.first)
# ---------- python_script_2.python (53 lines) ----------
# Copyright(c) 2017, Dimitar Venkov
# @5devene, dimitar.ven@gmail.com
# www.badmonkeys.net

import clr
clr.AddReference('RevitAPI')
from Autodesk.Revit.DB import *

clr.AddReference('RevitNodes')
import Revit
clr.ImportExtensions(Revit.Elements)

clr.AddReference('RevitServices')
import RevitServices
from RevitServices.Persistence import DocumentManager
from RevitServices.Transactions import TransactionManager
doc = DocumentManager.Instance.CurrentDBDocument

def tolist(x):
	if hasattr(x,'__iter__'): return x
	else : return [x]

famtypes = UnwrapElement(tolist(IN[0]) )

typeName = Element.Name.__get__(famtypes[0])

newNames = tolist(IN[1])

OUT = []
fec = FilteredElementCollector(doc).OfClass(famtypes[0].GetType() )


for i in fec:
	name = (Element.Name.__get__(i), i)[0]
	if name == typeName:
		element = i
	else:
		continue
		
newTypes = []

TransactionManager.Instance.EnsureInTransaction(doc)

for n in newNames:
	try:
		newTypes.append(element.Duplicate(n))
	except:
		newTypes.append("Name already in use: " + n)

TransactionManager.Instance.TransactionTaskDone()


OUT = newTypes
# ----------------------------------------

# group: Parameters
code_block_3 = CodeBlock { "Model"; }
code_block_4 = CodeBlock { "Height"; }
code_block_5 = CodeBlock { "Bottom Flange Width"; }
code_block_6 = CodeBlock { "Top Flange Width"; }
code_block_7 = CodeBlock { "Bottom Flange Thickness"; }
code_block_8 = CodeBlock { "Top Flange Thickness"; }
code_block_9 = CodeBlock { "Web Thickness"; }
code_block_10 = CodeBlock { "Section Area"; }

join = List.Join(list0=code_block_3, list1=code_block_4, list2=code_block_5, list3=code_block_6, list4=code_block_7, list5=code_block_8, list6=code_block_9, list7=code_block_10)
setParameterByName = Element.SetParameterByName(element=python_script_2, parameterName=join@L2, value=python_script, lacing=Longest)
code_block_11 = CodeBlock(a=deconstruct.first) { a; }
