# Dynamo graph Print_PDF - v08.dyn (Dynamo 0.8.2.2392)

file_path = Filename("C:\Users\giovanni.brogiolo\Documents\Project2_giovanni.brogiolo.rvt")
string = StringInput("C:\Users\giovanni.brogiolo\Desktop\Project2.rvt")
code_block = CodeBlock(item=string) { Flatten({item}); }
background_open = Python(IN[0]=code_block)
# ---------- background_open.python (39 lines) ----------
#Copyright(c) 2017, john pierson
# @60secondrevit, http://sixtysecondrevit.com
import clr
clr.AddReference('ProtoGeometry')
from Autodesk.DesignScript.Geometry import *

# Import Element wrapper extension methods
clr.AddReference("RevitNodes")
import Revit
clr.ImportExtensions(Revit.Elements)

# Import geometry conversion extension methods
clr.ImportExtensions(Revit.GeometryConversion)

# Import DocumentManager and TransactionManager
clr.AddReference("RevitServices")
import RevitServices
from RevitServices.Persistence import DocumentManager
from RevitServices.Transactions import TransactionManager

doc = DocumentManager.Instance.CurrentDBDocument
uiapp = DocumentManager.Instance.CurrentUIApplication
app = uiapp.Application

# Import RevitAPI
clr.AddReference("RevitAPI")
import Autodesk
from Autodesk.Revit.DB import *

items = IN[0]

typelist = list()
for i in items:
	try:
		typelist.append(app.OpenDocumentFile(i))
	except:
		typelist.append(list())
		
OUT = typelist
# ----------------------------------------
code_block_2 = CodeBlock(a=background_open) { a[0]; }
categories = Categories("Sheets")
get_all_elements_from_linked = Python(IN[0]=code_block_2, IN[1]=categories)  # "Get All Elements From Linked Model"
# ---------- get_all_elements_from_linked.python (42 lines) ----------
#Copyright(c) 2015, Konrad Sobon
# @arch_laboratory, http://archi-lab.net

# This node is based on Julien Benoit's Element.GetElementFromLinkedFile 
# node. Some slight improvements were made removing unnecessary imports/references.
# Big thank you to Julien for sharing his work. 

import clr
clr.AddReference('ProtoGeometry')
from Autodesk.DesignScript.Geometry import *

# Import RevitAPI
clr.AddReference("RevitAPI")
import Autodesk
from Autodesk.Revit.DB import *

import System

import sys
pyt_path = r'C:\Program Files (x86)\IronPython 2.7\Lib'
sys.path.append(pyt_path)

#The inputs to this node will be stored as a list in the IN variable.
dataEnteringNode = IN

_linkDoc = IN[0]
_category = IN[1]

try:
	errorReport = None
	filter = ElementCategoryFilter(System.Enum.ToObject(BuiltInCategory, _category.Id))
	result = FilteredElementCollector(_linkDoc).WherePasses(filter).WhereElementIsNotElementType().ToElements()
except:
	# if error accurs anywhere in the process catch it
	import traceback
	errorReport = traceback.format_exc()

#Assign your output to the OUT variable
if errorReport == None:
	OUT = result
else:
	OUT = errorReport
# ----------------------------------------
code_block_3 = CodeBlock(a=get_all_elements_from_linked) { a[0]; }
print_range = PrintRangeUI("Select")
boolean = BoolSelector(true)
local_printers_names = Custom[Local Printers Names]()  # This node will query all locally installed printers and return their names.
code_block_4 = CodeBlock(a=local_printers_names) { a[4]; }
print_settings = PrintSettingUI("a1")
file_path_2 = Filename("C:\Users\giovanni.brogiolo\Documents\bbb.pdf")
boolean_2 = BoolSelector(true)
string_2 = StringInput("C:\Users\giovanni.brogiolo\Documents\Project33.pdf")
python_script = Python(IN[0]=code_block_3, IN[1]=print_range, IN[2]=boolean, IN[3]=code_block_4, IN[4]=print_settings, IN[5]=file_path_2, IN[6]=boolean_2, IN[7]=string_2)
# ---------- python_script.python (131 lines) ----------
#Copyright(c) 2015, Konrad K Sobon
# @arch_laboratory, http://archi-lab.net

import clr
clr.AddReference('ProtoGeometry')
from Autodesk.DesignScript.Geometry import *

# Import Element wrapper extension methods
clr.AddReference("RevitNodes")
import Revit
clr.ImportExtensions(Revit.Elements)

# Import geometry conversion extension methods
clr.ImportExtensions(Revit.GeometryConversion)

# Import DocumentManager and TransactionManager
clr.AddReference("RevitServices")
import RevitServices
from RevitServices.Persistence import DocumentManager
from RevitServices.Transactions import TransactionManager

doc = DocumentManager.Instance.CurrentDBDocument
uiapp = DocumentManager.Instance.CurrentUIApplication
app = uiapp.Application

# Import RevitAPI
clr.AddReference("RevitAPI")
import Autodesk
from Autodesk.Revit.DB import *

import sys
pyt_path = r'C:\Program Files (x86)\IronPython 2.7\Lib'
sys.path.append(pyt_path)
import System

#The inputs to this node will be stored as a list in the IN variable.
dataEnteringNode = IN

sheets = IN[0]
pRange = System.Enum.Parse(Autodesk.Revit.DB.PrintRange, IN[1])
combined = IN[2]
printerName = IN[3]
printSetting = IN[4]
filePath = IN[5]
runIt = IN[6]

if isinstance(sheets, list):
	viewSheets = []
	for i in sheets:
		viewSheets.append(UnwrapElement(i))
else:
	viewSheets = UnwrapElement(sheets)

def PrintView(doc, sheet, pRange, printerName, combined, filePath, printSetting):
	# create view set 
	viewSet = ViewSet()
	viewSet.Insert(sheet)
	# determine print range
	printManager = doc.PrintManager
	printManager.PrintRange = pRange
	printManager.Apply()
	# make new view set current
	viewSheetSetting = printManager.ViewSheetSetting
	viewSheetSetting.CurrentViewSheetSet.Views = viewSet
	# set printer
	printManager.SelectNewPrintDriver(printerName)
	printManager.Apply()
	# set combined and print to file
	if printManager.IsVirtual:
		printManager.CombinedFile = combined
		printManager.Apply()
		printManager.PrintToFile = True
		printManager.Apply()
	else:
		printManager.CombinedFile = combined
		printManager.Apply()
		printManager.PrintToFile = False
		printManager.Apply()
	# set file path
	printManager.PrintToFileName = filePath
	printManager.Apply()
	# apply print setting
	try:
		printSetup = printManager.PrintSetup
		printSetup.CurrentPrintSetting = printSetting
		printManager.Apply()
	except:
		pass
	# save settings and submit print
	TransactionManager.Instance.EnsureInTransaction(doc)
	viewSheetSetting.SaveAs("tempSetName")
	printManager.Apply()
	printManager.SubmitPrint()
	viewSheetSetting.Delete()
	TransactionManager.Instance.TransactionTaskDone()
	
	return True

try:
	viewSets = FilteredElementCollector(doc).OfClass(ViewSheetSet)
	for i in viewSets:
		if i.Name == "tempSetName":
			TransactionManager.Instance.EnsureInTransaction(doc)
			doc.Delete(i.Id)
			TransactionManager.Instance.ForceCloseTransaction()
		else:
			continue
		
	errorReport = None
	message = "Success"
	if runIt:
		if isinstance(viewSheets, list) and isinstance(printSetting, list):
			for i, j in zip(viewSheets, printSetting):
				PrintView(doc, i, pRange, printerName, combined, filePath, j)
		elif isinstance(viewSheets, list) and not isinstance(printSetting, list):
			for i in viewSheets:
				PrintView(doc, i, pRange, printerName, combined, filePath, printSetting)
		elif not isinstance(viewSheets, list) and not isinstance(printSetting, list):
			PrintView(doc, viewSheets, pRange, printerName, combined, filePath, printSetting)
	else:
		message = "Set RunIt to True"
except:
	# if error accurs anywhere in the process catch it
	import traceback
	errorReport = traceback.format_exc()
	
#Assign your output to the OUT variable
if errorReport == None:
	OUT = message
else:
	OUT = errorReport
# ----------------------------------------
