# Dynamo graph RevitApiGeometry02.dyn (Dynamo 1.3.0.875)

# group: FILLED REGION TYPE
element_types = ElementTypes("FilledRegionType")
all_elements_of_type = ElementsOfType(element_types)
code_block = CodeBlock(a=all_elements_of_type) { {a[6]}; }
code_block_2 = CodeBlock(a=code_block) { a; }

python_script = Python(IN[0]=code_block_2)
# ---------- python_script.python (88 lines) ----------
import clr
clr.AddReference('ProtoGeometry')
from Autodesk.DesignScript.Geometry import *

# Import DocumentManager and TransactionManager
clr.AddReference("RevitServices")
import RevitServices
from RevitServices.Persistence import DocumentManager
from RevitServices.Transactions import TransactionManager

# Import RevitAPI
clr.AddReference("RevitAPI")
import Autodesk
from Autodesk.Revit.DB import *

doc = DocumentManager.Instance.CurrentDBDocument
uiapp = DocumentManager.Instance.CurrentUIApplication
app = uiapp.Application

activeViewId = doc.ActiveView.Id;

regions = []
#planePts = UnwrapElement(IN[0])
frt = UnwrapElement(IN[0])

centre = XYZ(100,10,50)

frame = Frame( centre, XYZ.BasisX, XYZ.BasisY, XYZ.BasisZ )

radius = 1

arc = Arc.Create(XYZ(-10,0),XYZ(10,10,0),XYZ(10,0,0))

line = Line.CreateBound(arc.GetEndPoint( 1 ), arc.GetEndPoint( 0 ) );

halfCircle = CurveLoop()

halfCircle.Append( arc )
halfCircle.Append( line )

profileLoops = []
profileLoops.Add(halfCircle)

TransactionManager.Instance.EnsureInTransaction(doc)

region = FilledRegion.Create(doc,frt[0].Id,activeViewId,profileLoops)
regions.Add(region)

TransactionManager.Instance.TransactionTaskDone()


"""
regions = []




profileLoops = []

halfCircle = CurveLoop()
profileLoops.Add(halfCircle)


radius = 1000;
startAngle = 0
endAngle = 180

plane = Plane.CreateByThreePoints(ptCoord[0],ptCoord[1],ptCoord[2])
arc1 = Arc.Create(plane, radius, 0, 180)
#arc2 = Arc.MakeBound(arc1,0,1)
arc2 = Arc.Create(plane, radius, 180, 360)

#arc3 = Arc.Create(arc2.GetEndPoint(1),arc2.GetEndPoint(0),arc2.Evaluate(0.5,True))


halfCircle.Append(arc1)
#halfCircle.Append(arc2)


halfCircle.Append(arc1)
halfCircle.Append(arc2)
region = FilledRegion.Create(doc,frt[0].Id,activeViewId,profileLoops)
regions.Add(region)

"""

#Assign your outputs to the OUT variable
OUT = regions
# ----------------------------------------
name = Element.Name(all_elements_of_type)
