# Dynamo graph SetFilledRegionLineStyle.dyn (Dynamo 0.8.2.2392)

select_model_elements = DSModelElementsSelection()
python_script = Python(IN[0]=select_model_elements)
# ---------- python_script.python (33 lines) ----------
import clr
clr.AddReference('ProtoGeometry')
from Autodesk.DesignScript.Geometry import *

# Import DocumentManager and TransactionManager
clr.AddReference("RevitServices")
import RevitServices
from RevitServices.Persistence import DocumentManager
from RevitServices.Transactions import TransactionManager

# Import RevitAPI
clr.AddReference("RevitAPI")
import Autodesk
from Autodesk.Revit.DB import *

doc = DocumentManager.Instance.CurrentDBDocument
uiapp = DocumentManager.Instance.CurrentUIApplication
app = uiapp.Application


region = UnwrapElement(IN[0])

ids = UnwrapElement(IN[1])

TransactionManager.Instance.EnsureInTransaction(doc)

for r in region:
	FilledRegion.SetLineStyleId(r, ids.Id)

TransactionManager.Instance.TransactionTaskDone()

#Assign your outputs to the OUT variable
OUT = region
# ----------------------------------------
categories = Categories("Lines")
all_elements_of_category = ElementsOfCategory(categories)
code_block = CodeBlock { "Line Style"; }
getParameterValueByName = Element.GetParameterValueByName(element=all_elements_of_category, parameterName=code_block)
name = Element.Name(getParameterValueByName)
code_block_2 = CodeBlock { "Thin Lines"; }
indexOf = IndexOf(name, code_block_2)
getItemAtIndex = List.GetItemAtIndex(list=getParameterValueByName, index=indexOf)
code_block_3 = CodeBlock { "<"; }
contains = String.Contains(str=name, searchFor=code_block_3)
filterByBoolMask = List.FilterByBoolMask(list=name, mask=contains)
revit_id_to_element = Custom[Revit ID to Element]()
