# Dynamo graph SetFilledRegionLineStyle01.dyn (Dynamo 1.3.0.875)

select_model_elements = DSModelElementsSelection()  # 3 picked in the model
python_script = Python(IN[0]=select_model_elements)  # unwired: IN[1]
# ---------- python_script.python (33 lines) ----------
import clr
clr.AddReference('ProtoGeometry')
from Autodesk.DesignScript.Geometry import *

# Import DocumentManager and TransactionManager
clr.AddReference("RevitServices")
import RevitServices
from RevitServices.Persistence import DocumentManager
from RevitServices.Transactions import TransactionManager

# Import RevitAPI
clr.AddReference("RevitAPI")
import Autodesk
from Autodesk.Revit.DB import *

doc = DocumentManager.Instance.CurrentDBDocument
uiapp = DocumentManager.Instance.CurrentUIApplication
app = uiapp.Application


region = UnwrapElement(IN[0])

ids = UnwrapElement(IN[1])

TransactionManager.Instance.EnsureInTransaction(doc)

for r in region:
	FilledRegion.SetLineStyleId(r, ids.Id)

TransactionManager.Instance.TransactionTaskDone()

#Assign your outputs to the OUT variable
OUT = region
# ----------------------------------------
categories = Categories("Lines")
all_elements_of_category = ElementsOfCategory(categories)
code_block = CodeBlock { "Line Style"; }
getParameterValueByName = Element.GetParameterValueByName(element=all_elements_of_category, parameterName=code_block)
name = Element.Name(getParameterValueByName)
code_block_2 = CodeBlock { "Wide Lines"; }
indexOf = IndexOf(name, code_block_2)
getItemAtIndex = List.GetItemAtIndex(list=getParameterValueByName, index=indexOf)
code_block_3 = CodeBlock { "<"; }
contains = String.Contains(str=name, searchFor=code_block_3)
filterByBoolMask = List.FilterByBoolMask(list=name, mask=contains)
revit_id_to_element = Custom[Revit ID to Element]()  # unwired: Revit_ID
get_revit_activeview = Custom[Get Revit ActiveView]()  # Active View
python_script_2 = Python(IN[0]=select_model_elements, IN[1]=get_revit_activeview)
# ---------- python_script_2.python (50 lines) ----------
import clr
clr.AddReference('ProtoGeometry')
from Autodesk.DesignScript.Geometry import *

# Import DocumentManager and TransactionManager
clr.AddReference("RevitServices")
import RevitServices
from RevitServices.Persistence import DocumentManager
from RevitServices.Transactions import TransactionManager

# Import RevitAPI
clr.AddReference("RevitAPI")
import Autodesk
from Autodesk.Revit.DB import *

clr.AddReference("RevitNodes")
import Revit
clr.ImportExtensions(Revit.GeometryConversion)


doc = DocumentManager.Instance.CurrentDBDocument
uiapp = DocumentManager.Instance.CurrentUIApplication
app = uiapp.Application


region = UnwrapElement(IN[0])

view = UnwrapElement(IN[1])

geomOption = app.Create.NewGeometryOptions()
geomOption.View = view
geomOption.IncludeNonVisibleObjects = 0

edgeArray = []
for r in region:
	geomElem = r.get_Geometry(geomOption)
	enum1 = geomElem.GetEnumerator() ; enum1.MoveNext()
	geo2 = enum1.Current
	edgeArray.append(geo2.Edges)

lineStyles = []

for i in range(0,len(edgeArray)):
	ls =[]
	lineStyles.append(ls)
	for edge in edgeArray[i]:
		ls.append(doc.GetElement(edge.GraphicsStyleId))

#Assign your outputs to the OUT variable
OUT = lineStyles
# ----------------------------------------
python_script_3 = Python(IN[0]=select_model_elements, IN[1]=get_revit_activeview)
# ---------- python_script_3.python (49 lines) ----------
import clr
clr.AddReference('ProtoGeometry')
from Autodesk.DesignScript.Geometry import *

# Import DocumentManager and TransactionManager
clr.AddReference("RevitServices")
import RevitServices
from RevitServices.Persistence import DocumentManager
from RevitServices.Transactions import TransactionManager

# Import RevitAPI
clr.AddReference("RevitAPI")
import Autodesk
from Autodesk.Revit.DB import *

clr.AddReference("RevitNodes")
import Revit
clr.ImportExtensions(Revit.GeometryConversion)


doc = DocumentManager.Instance.CurrentDBDocument
uiapp = DocumentManager.Instance.CurrentUIApplication
app = uiapp.Application


region = UnwrapElement(IN[0])

view = UnwrapElement(IN[1])

geomOption = app.Create.NewGeometryOptions()
geomOption.View = view
geomOption.IncludeNonVisibleObjects = 0

geomElem = region.get_Geometry(geomOption)

enum1 = geomElem.GetEnumerator() ; enum1.MoveNext()
geo2 = enum1.Current

face = geo2.Faces
edgeArray = geo2.Edges

lineStyles = []

for edge in edgeArray:
	lineStyles.append(doc.GetElement(edge.GraphicsStyleId))


#Assign your outputs to the OUT variable
OUT = lineStyles
# ----------------------------------------
