# Dynamo graph SetGridExtents.dyn (Dynamo 1.3.0.875)

get_revit_activeview = Custom[Get Revit ActiveView]()  # Active View
python_script = Python(IN[1]=get_revit_activeview)  # unwired: IN[0]
# ---------- python_script.python (49 lines) ----------
import clr
clr.AddReference('ProtoGeometry')
from Autodesk.DesignScript.Geometry import *

# Import DocumentManager and TransactionManager
clr.AddReference("RevitServices")
import RevitServices
from RevitServices.Persistence import DocumentManager
from RevitServices.Transactions import TransactionManager

# Import RevitAPI
clr.AddReference("RevitAPI")
import Autodesk
from Autodesk.Revit.DB import *

clr.AddReference("RevitNodes")
import Revit
clr.ImportExtensions(Revit.GeometryConversion)


doc = DocumentManager.Instance.CurrentDBDocument
uiapp = DocumentManager.Instance.CurrentUIApplication
app = uiapp.Application


grids = UnwrapElement(IN[0])
view = UnwrapElement(IN[1])

curves = []
curvesViews = []

TransactionManager.Instance.EnsureInTransaction(doc)

for g in grids:	
	g.SetDatumExtentType(DatumEnds.End0,view,DatumExtentType.ViewSpecific)
	g.SetDatumExtentType(DatumEnds.End1,view,DatumExtentType.ViewSpecific)
	curves.append(g.GetCurvesInView(DatumExtentType.Model, view))
	curvesViews.append(g.GetCurvesInView(DatumExtentType.ViewSpecific, view))

TransactionManager.Instance.TransactionTaskDone()
	
dynaCrvs = []

for cv in curvesViews:
	dynaCrvs.append(cv[0].ToProtoType())

	
#Assign your outputs to the OUT variable
OUT = curves,curvesViews,dynaCrvs
# ----------------------------------------
code_block = CodeBlock(a=python_script) { a[2]; }
length = Curve.Length(code_block)
renumberGridsByCurve = Custom[Rhythm.RenumberGridsByCurve]()  # This node will renumber grids in order of curve drawn through them. Select either letters or numbers. (Alphanumeric coming soon); unwired: modelCurve, startCharacter
select_model_elements = DSModelElementsSelection()  # 2 picked in the model
curve = Grid.Curve(select_model_elements)
type = Object.Type(curve)
select_model_element = DSModelElementSelection()  # 1 picked in the model
pick_model_elements = Custom[Pick Model Elements]()  # This node offers a pick method for selecting elements in Revit.
curves = Element.Curves(pick_model_elements)
code_block_2 = CodeBlock { Vector.ZAxis(); }
code_block_3 = CodeBlock { 300; }
translate = Geometry.Translate(geometry=curves, direction=code_block_2, distance=code_block_3)
flatten = Flatten(translate)
endPoints = Geometry.Curves.EndPoints(flatten)
python_script_2 = Python(IN[0]=endPoints.out0, IN[1]=endPoints.out1)
# ---------- python_script_2.python (36 lines) ----------
import clr
clr.AddReference('ProtoGeometry')
from Autodesk.DesignScript.Geometry import *

# Import DocumentManager and TransactionManager
clr.AddReference("RevitServices")
import RevitServices
from RevitServices.Persistence import DocumentManager
from RevitServices.Transactions import TransactionManager

# Import RevitAPI
clr.AddReference("RevitAPI")
import Autodesk
from Autodesk.Revit.DB import *

clr.AddReference("RevitNodes")
import Revit
clr.ImportExtensions(Revit.GeometryConversion)


doc = DocumentManager.Instance.CurrentDBDocument
uiapp = DocumentManager.Instance.CurrentUIApplication
app = uiapp.Application


startPts = UnwrapElement(IN[0])
endPts = UnwrapElement(IN[1])
revitCurves = []

  
for i in range(0,len(startPts)):
	newLine = Line.CreateBound(startPts[i].ToXyz(),endPts[i].ToXyz())
	revitCurves.append(newLine)
    
#Assign your outputs to the OUT variable
OUT = revitCurves
# ----------------------------------------
python_script_3 = Python(IN[0]=select_model_elements, IN[1]=get_revit_activeview, IN[2]=python_script_2)
# ---------- python_script_3.python (44 lines) ----------
import clr
clr.AddReference('ProtoGeometry')
from Autodesk.DesignScript.Geometry import *

# Import DocumentManager and TransactionManager
clr.AddReference("RevitServices")
import RevitServices
from RevitServices.Persistence import DocumentManager
from RevitServices.Transactions import TransactionManager

# Import RevitAPI
clr.AddReference("RevitAPI")
import Autodesk
from Autodesk.Revit.DB import *

clr.AddReference("RevitNodes")
import Revit
clr.ImportExtensions(Revit.GeometryConversion)


doc = DocumentManager.Instance.CurrentDBDocument
uiapp = DocumentManager.Instance.CurrentUIApplication
app = uiapp.Application


grids = UnwrapElement(IN[0])
view = UnwrapElement(IN[1])
crvs = UnwrapElement(IN[2])

curves = []
curvesViews = []

TransactionManager.Instance.EnsureInTransaction(doc)

for i in range(0,len(grids)):	
	grids[i].SetCurveInView(DatumExtentType.ViewSpecific,view,crvs[i])


TransactionManager.Instance.TransactionTaskDone()
	

	
#Assign your outputs to the OUT variable
OUT = grids
# ----------------------------------------
pick_model_elements_2 = Custom[Pick Model Elements]()
geometry = Element.Geometry(pick_model_elements_2)
curve_2 = Grid.Curve(select_model_elements)
code_block_4 = CodeBlock(curve=curve_2) { curve[0]; }
startPoint = Curve.StartPoint(code_block_4)
byOriginNormal = Plane.ByOriginNormal(origin=startPoint)
pullOntoPlane = Curve.PullOntoPlane(curve=geometry@L1, plane=byOriginNormal, lacing=Longest)
intersectAll = Geometry.IntersectAll(geometry=pullOntoPlane@L1, others=curve_2, lacing=CrossProduct)
flatten_2 = Flatten(intersectAll@L3)
transpose = List.Transpose(flatten_2)
deconstruct = List.Deconstruct(list=transpose@L2)
byStartPointEndPoint = Line.ByStartPointEndPoint(startPoint=deconstruct.first, endPoint=deconstruct.rest)
flatten_3 = Flatten(byStartPointEndPoint)
type_2 = Object.Type()  # unwired: arg0
code_block_5 = CodeBlock { 0; }
offset = Curve.Offset(curve=pick_model_elements, distance=code_block_5)
python_script_4 = Python(IN[0]=curve_2)
# ---------- python_script_4.python (35 lines) ----------
import clr
clr.AddReference('ProtoGeometry')
from Autodesk.DesignScript.Geometry import *

# Import DocumentManager and TransactionManager
clr.AddReference("RevitServices")
import RevitServices
from RevitServices.Persistence import DocumentManager
from RevitServices.Transactions import TransactionManager

# Import RevitAPI
clr.AddReference("RevitAPI")
import Autodesk
from Autodesk.Revit.DB import *

clr.AddReference("RevitNodes")
import Revit
clr.ImportExtensions(Revit.GeometryConversion)


doc = DocumentManager.Instance.CurrentDBDocument
uiapp = DocumentManager.Instance.CurrentUIApplication
app = uiapp.Application


crvs = UnwrapElement(IN[0])
revitCurves = []

for c in crvs:
	revitCurves.append(c.ToRevitType())


	
#Assign your outputs to the OUT variable
OUT = revitCurves
# ----------------------------------------
python_script_5 = Python(IN[0]=python_script_4)
# ---------- python_script_5.python (39 lines) ----------
import clr
clr.AddReference('ProtoGeometry')
from Autodesk.DesignScript.Geometry import *

# Import DocumentManager and TransactionManager
clr.AddReference("RevitServices")
import RevitServices
from RevitServices.Persistence import DocumentManager
from RevitServices.Transactions import TransactionManager

# Import RevitAPI
clr.AddReference("RevitAPI")
import Autodesk
from Autodesk.Revit.DB import *

clr.AddReference("RevitNodes")
import Revit
clr.ImportExtensions(Revit.GeometryConversion)


doc = DocumentManager.Instance.CurrentDBDocument
uiapp = DocumentManager.Instance.CurrentUIApplication
app = uiapp.Application


crvs = UnwrapElement(IN[0])
revitCurves = []

  
for c in crvs:
	start = c.GetEndPoint(0)
	end = c.GetEndPoint(1)
	newStart = start + 10 * XYZ.BasisY
	newEnd = end - 10 * XYZ.BasisY
	newLine = Line.CreateBound(newStart,newEnd)
	revitCurves.append(newLine)
    
#Assign your outputs to the OUT variable
OUT = revitCurves
# ----------------------------------------
setVerticalExtents = Custom[Grid.SetVerticalExtents]()  # Set the vertical extents of all project grids; unwired: Bottom_extent, Top_extent
python_script_6 = Python()  # unwired: IN[0], IN[1]
# ---------- python_script_6.python (24 lines) ----------
#Copyright (c) mostafa el ayoubi
#Node-mode www.data-shapes.net 2016 elayoub.mostafa@gmail.com

import clr
clr.AddReference('RevitAPI')
from Autodesk.Revit.DB import*
clr.AddReference('RevitServices')
from RevitServices.Persistence import DocumentManager
from RevitServices.Transactions import TransactionManager

doc = DocumentManager.Instance.CurrentDBDocument
UIunit = Document.GetUnits(doc).GetFormatOptions(UnitType.UT_Length).DisplayUnits

def convunit(x):
	return UnitUtils.ConvertToInternalUnits(x,UIunit)

grids = [UnwrapElement(i) for i in FilteredElementCollector(doc).OfClass(Grid)]

TransactionManager.Instance.EnsureInTransaction(doc)
for g in grids:
	g.SetVerticalExtents(convunit(IN[0]),convunit(IN[1]))
TransactionManager.Instance.TransactionTaskDone()

OUT = grids
# ----------------------------------------
flatten_4 = Flatten()  # unwired: arg0
python_script_7 = Python(IN[1]=get_revit_activeview)  # unwired: IN[0]
# ---------- python_script_7.python (59 lines) ----------
import clr
clr.AddReference('ProtoGeometry')
from Autodesk.DesignScript.Geometry import *

# Import DocumentManager and TransactionManager
clr.AddReference("RevitServices")
import RevitServices
from RevitServices.Persistence import DocumentManager
from RevitServices.Transactions import TransactionManager

# Import RevitAPI
clr.AddReference("RevitAPI")
import Autodesk
from Autodesk.Revit.DB import *

clr.AddReference("RevitNodes")
import Revit
clr.ImportExtensions(Revit.GeometryConversion)


doc = DocumentManager.Instance.CurrentDBDocument
uiapp = DocumentManager.Instance.CurrentUIApplication
app = uiapp.Application


grids = UnwrapElement(IN[0])
view = UnwrapElement(IN[1])

curves = []
gridCurves = []

TransactionManager.Instance.EnsureInTransaction(doc)

for g in grids:	
	g.SetDatumExtentType(DatumEnds.End0,view,DatumExtentType.ViewSpecific)
	g.SetDatumExtentType(DatumEnds.End1,view,DatumExtentType.ViewSpecific)
	curves.append(g.GetCurvesInView(DatumExtentType.Model, view))
	gridCurves.append(g.GetCurvesInView(DatumExtentType.ViewSpecific, view))

TransactionManager.Instance.TransactionTaskDone()
	
dynaCrvs = []
new = []

for i in range(0,len(gridCurves)):
	for c in gridCurves[i]:
		start = c.GetEndPoint(0)
		end = c.GetEndPoint(1)
		oldLine = Line.CreateBound(start,end).ToProtoType()
		newStart = start -5 * XYZ.BasisY
		newEnd = end +5 * XYZ.BasisY
		newLine = Line.CreateBound(newStart,newEnd)
		dynaCrvs.append(oldLine)
		new.append(newLine.ToProtoType())
		#grids[i].SetCurveInView(DatumExtentType.ViewSpecific, view, newLine)

	
#Assign your outputs to the OUT variable
OUT = dynaCrvs,new
# ----------------------------------------
startPoint_2 = Curve.StartPoint(curve_2)
code_block_6 = CodeBlock(a=flatten_2) { a[0]; }
distance_between_point = Custom[Distance Between Point](Point=startPoint_2, Point_2=code_block_6)  # Calculate the distance between 2 set of Point.
python_script_8 = Python(IN[1]=distance_between_point)  # unwired: IN[0], IN[2]
# ---------- python_script_8.python (29 lines) ----------
#Copyright (c) mostafa el ayoubi
#Node-mode www.data-shapes.net 2016 elayoub.mostafa@gmail.com

import clr
clr.AddReference('RevitAPI')
from Autodesk.Revit.DB import*
clr.AddReference('RevitServices')
from RevitServices.Persistence import DocumentManager
from RevitServices.Transactions import TransactionManager

doc = DocumentManager.Instance.CurrentDBDocument
UIunit = Document.GetUnits(doc).GetFormatOptions(UnitType.UT_Length).DisplayUnits

def convunit(x):
	return UnitUtils.ConvertToInternalUnits(x,UIunit)
def tolist(input):
	if isinstance(input,list):
		return UnwrapElement(input)
	else:
		return [UnwrapElement(input)]

grids = tolist(IN[0])

TransactionManager.Instance.EnsureInTransaction(doc)
for g,bottom,top in zip(grids,IN[1],IN[2]):
	g.SetVerticalExtents(convunit(bottom),convunit(top))
TransactionManager.Instance.TransactionTaskDone()

OUT = grids
# ----------------------------------------
code_block_7 = CodeBlock { {0,0}; }
code_block_8 = CodeBlock(a=select_model_elements) { a; }
