# Dynamo graph SetPileLengths.dyn (Dynamo 1.3.3.4651)

select_model_elements = DSModelElementsSelection()  # 26 picked in the model
code_block = CodeBlock { {"Height Offset From Level", "Dimensions_Foundation_Pile_Length"}; }
getParameterValueByName = Element.GetParameterValueByName(element=select_model_elements, parameterName=code_block, lacing=CrossProduct)
code_block_2 = CodeBlock { 100; }
add = getParameterValueByName + code_block_2
setParameterByName = Element.SetParameterByName(element=select_model_elements, parameterName=code_block@L2, value=add, lacing=Longest)
