# Dynamo graph SpliceConnectionSet.dyn (Dynamo 1.3.2.2480)

select_model_element = DSModelElementSelection()  # 1 picked in the model
code_block = CodeBlock { {"Beam_Depth","Flange_Plate_Width","Flange_Thickness","Web_Thickness","Flange_Clamp_Width"}; }
select_model_element_2 = DSModelElementSelection()  # 1 picked in the model
code_block_2 = CodeBlock { "Type"; }
getParameterValueByName = Element.GetParameterValueByName(element=select_model_element_2, parameterName=code_block_2)
code_block_3 = CodeBlock { {"d","bf","tf","tw"}; }
getParameterValueByName_2 = Element.GetParameterValueByName(element=getParameterValueByName, parameterName=code_block_3)
code_block_4 = CodeBlock(a=getParameterValueByName_2) { a[1]/2-a[3]/2; }
code_block_5 = CodeBlock(a=getParameterValueByName_2, b=code_block_4) { {a,b}; }
flatten = Flatten(code_block_5)
setParameterByName = Element.SetParameterByName(element=select_model_element, parameterName=code_block, value=flatten)
