# Dynamo graph SplitWall01.dyn (Dynamo 2.0.2.6826)

# group: Select the walls to split
select_model_elements = DSModelElementsSelection()  # 1 picked in the model

byCoordinates = Vector.ByCoordinates()

# group: Get the wall base level
categories = Categories(index=248)
all_elements_of_category = ElementsOfCategory(Category=categories)
code_block = CodeBlock { "Base Constraint"; }
getParameterValueByName = Element.GetParameterValueByName(element=select_model_elements, parameterName=code_block)
allIndicesOf = List.AllIndicesOf(list=all_elements_of_category, item=getParameterValueByName)

# group: Get the wall top level
code_block_2 = CodeBlock { "Top Constraint"; }

getParameterValueByName_2 = Element.GetParameterValueByName(element=select_model_elements, parameterName=code_block_2)

# group (continued): Get the wall top level
allIndicesOf_2 = List.AllIndicesOf(list=all_elements_of_category, item=getParameterValueByName_2)

# group: Get all the base levels between base and top
python_script = Python(IN[0]=allIndicesOf, IN[1]=allIndicesOf_2)
# ---------- python_script.python (17 lines) ----------
base = IN[0]
top = IN[1]


result = []

for b,t in zip(base, top):
	sub = []
	result.append(sub)
	try:
		for i in range(b[0], t[0]):
			sub.append(i)
	except:
		for i in range(b, t):
			sub.append(i)

OUT = result
# ----------------------------------------
getItemAtIndex = List.GetItemAtIndex(list=all_elements_of_category, index=python_script)

count = List.Count(list=getItemAtIndex, lacing=Longest)
code_block_3 = CodeBlock(a=count) { a-1; }
ofRepeatedItem = List.OfRepeatedItem(item=byCoordinates, amount=code_block_3)
copyElement = StructuralDesign.Model.Geometry.CopyElement(element=select_model_elements, vector=ofRepeatedItem)
flatten = List.Flatten(list=copyElement)
addItemToFront = List.AddItemToFront(item=select_model_elements, list=flatten)

# group: Get all the top levels between base and top
python_script_2 = Python(IN[0]=allIndicesOf, IN[1]=allIndicesOf_2)
# ---------- python_script_2.python (16 lines) ----------
base = IN[0]
top = IN[1]

result = []

for b,t in zip(base, top):
	sub = []
	result.append(sub)
	try:
		for i in range(b[0], t[0]):
			sub.append(i+1)
	except:
		for i in range(b, t):
			sub.append(i+1)

OUT = result
# ----------------------------------------
getItemAtIndex_2 = List.GetItemAtIndex(list=all_elements_of_category, index=python_script_2)

flatten_2 = List.Flatten(list=getItemAtIndex_2)
flatten_3 = List.Flatten(list=getItemAtIndex)
code_block_4 = CodeBlock { true; }
count_2 = List.Count(list=getItemAtIndex_2, lacing=Longest)
ofRepeatedItem_2 = List.OfRepeatedItem(item=code_block_4, amount=count_2)
flatten_4 = List.Flatten(list=ofRepeatedItem_2)

# group: Set the wall to structural
code_block_5 = CodeBlock { ["Top Constraint", "Base Constraint", "Structural"]; }
code_block_6 = CodeBlock(top=flatten_2, bottom=flatten_3, structural=flatten_4) { [top, bottom, structural]; }

transpose = List.Transpose(lists=code_block_6)

# group (continued): Set the wall to structural
setParameterByName = Element.SetParameterByName(element=addItemToFront, parameterName=code_block_5@L2, value=transpose, lacing=Longest)

# group: Unjoin the walls
flatten_5 = List.Flatten()  # unwired: list
python_script_3 = Python(IN[0]=flatten_5)
# ---------- python_script_3.python (31 lines) ----------
import clr
clr.AddReference('RevitAPI')
from Autodesk.Revit.DB import *
from System.Collections.Generic import *
clr.AddReference("RevitServices")
import RevitServices
from RevitServices.Persistence import DocumentManager
from RevitServices.Transactions import TransactionManager

doc = DocumentManager.Instance.CurrentDBDocument

#The inputs to this node will be stored as a list in the IN variables.
dataEnteringNode = IN

walls = UnwrapElement(IN[0])


TransactionManager.Instance.EnsureInTransaction(doc)
booleans=[]
for wall in walls:
	try:
		WallUtils.DisallowWallJoinAtEnd(wall, 0)
		WallUtils.DisallowWallJoinAtEnd(wall, 1)
		booleans.append(True)
	except:
		booleans.append(False)

TransactionManager.Instance.TransactionTaskDone()

#Assign your output to the OUT variable.
OUT = booleans
# ----------------------------------------
