# Dynamo graph TagChecker02.dyn (Dynamo 2.0.1.5055)

boolean = BoolSelector(true)
python_script = Python(IN[0]=boolean)
# ---------- python_script.python (334 lines) ----------
import clr

clr.AddReference("System.Windows.Forms")
from System.Windows.Forms import Application, Button, Form, Label, TextBox, CheckBox, FolderBrowserDialog, OpenFileDialog, DialogResult, ComboBox, FormBorderStyle, FormStartPosition

clr.AddReference("System.Drawing")
from System.Drawing import Point as dPoint
from System.Drawing import Size as dSize


clr.AddReference("System")
from System import EventHandler


clr.AddReference("RevitAPIUI")
from Autodesk.Revit.UI import IExternalEventHandler, ExternalEvent, TaskDialog
from Autodesk.Revit.UI.Selection import *

clr.AddReference("RevitAPI")
from Autodesk.Revit.DB import Transaction, OverrideGraphicSettings, ElementId, Color
# noinspection PyUnresolvedReferences
from Autodesk.Revit.Exceptions import InvalidOperationException


clr.AddReference('RevitServices')
from RevitServices.Persistence import DocumentManager


global result



doc = DocumentManager.Instance.CurrentDBDocument
uidoc = DocumentManager.Instance.CurrentUIApplication.ActiveUIDocument


class CustomISelectionFilter(ISelectionFilter):
	def __init__(self, category_name):
		self.category_name = category_name
	def AllowElement(self, e):
		if e.Category.Name == self.category_name:
			return True
		else:
			return False
	def AllowReference(self, ref, point):
		return false
		



    


usage = {"Primary" : "PB", "Secondary" : "SB", "Vertical Bracing" : "VB", "Diaphragm" : "DB"}


def MarkGenerator(beamId):
	beam = doc.GetElement(beamId)
	xDist = abs((beam.Location.Curve.Evaluate(0.5, True).X*304.8 + 67286.598)/1000)
	yDist = abs((beam.Location.Curve.Evaluate(0.5, True).Y*304.8 - 559.835)/1000)
	lvlId = beam.LookupParameter("Reference Level").AsElementId()
	lvlName = doc.GetElement(lvlId).Name
	s = lvlName.Split(' ')
	if s[1] == "Ground":
		s = ["Upper Ground","UG"]
	try:
		usageValue = usage[beam.LookupParameter("Str Framing Use").AsString()]
	except:
		usageValue = "Usage error"
	if xDist<9.5 and yDist<10:
		value = '{}{}0{:.0f}0{:.0f}'.format(s[1],usageValue, xDist,yDist)
	elif xDist<9.5:
		value = '{}{}0{:.0f}{:.0f}'.format(s[1],usageValue, xDist,yDist)
	elif yDist<9.5:
		value = '{}{}{:.0f}0{:.0f}'.format(s[1],usageValue, xDist,yDist)
	else:
		value = '{}{}{:.0f}{:.0f}'.format(s[1],usageValue, xDist,yDist)
	return value

def GetMark(beamId):
	p = doc.GetElement(beamId).LookupParameter("Mark")
	return p.AsString()


def SetTagAndOverride(elementsIds):
	t = Transaction(doc, "Set Tag and Override")
	t.Start()
	[OverrideColor(elid) for elid in elementsIds]
	[setTemporaryMark(elid) for elid in elementsIds]
	t.Commit()

def TagAndOverride():
	#elementsIds = uidoc.Selection.GetElementIds() GIVES ERROR WITH WB AND PG BEAMS!
	ref = uidoc.Selection.PickObject(ObjectType.Element, CustomISelectionFilter("Structural Framing"), "Select a Beam")
	elementsIds = [doc.GetElement(ref).Id]
	form.addElements(elementsIds)
	SetTagAndOverride(elementsIds)
	#TaskDialog.Show("resu;t", ":Tagg")

def TagAndOverrideMultiple():
	ref = uidoc.Selection.PickObjects(ObjectType.Element, CustomISelectionFilter("Structural Framing"), "Select multiple beams")
	elementsIds = [doc.GetElement(r).Id for r in ref]
	form.addElements(elementsIds)
	SetTagAndOverride(elementsIds)

def DiscardChanges(elementIds, originalMarks):
	t = Transaction(doc, "Discard changes")
	t.Start()
	ResetOverrideColor(elementIds)
	assignOriginalMark(elementIds, originalMarks)
	t.Commit()
	form.elementsIds = []	# Reset list elements
	form.originalMarks = []	# Reset marks
	

def AcceptChanges(elementIds):
	t = Transaction(doc, "Cancel operation")
	t.Start()
	ResetOverrideColor(elementIds)
	assignMark(elementIds)
	t.Commit()
	form.elementsIds = []	# Reset list elements
	form.originalMarks = []	# Reset marks
	
	

def ResetOverrideColor(elements):
	v = doc.ActiveView
	booleans = []
	override = OverrideGraphicSettings()	
	for item in elements:
		try:
			v.SetElementOverrides(item, override)
			booleans.append(True)
		except:
			booleans.append(False)
	#TaskDialog.Show("result", str( len(elements) ) )
	return booleans
	

def setTemporaryMark(elid):
	tag = MarkGenerator(elid)
	p = doc.GetElement(elid).LookupParameter("Mark")
	form.originalMarks.append(p.AsString())
	p.Set(p.AsString() + "(new:" + tag + ")")
	

def assignMark(elementIds):
	for elid in elementIds:
		tag = MarkGenerator(elid)
		p = doc.GetElement(elid).LookupParameter("Mark")
		p.Set(tag)

def assignOriginalMark(elementIds, marks):
	for elid,mark in zip(elementIds,marks):
		p = doc.GetElement(elid).LookupParameter("Mark")
		p.Set(mark)

def OverrideColor(elid):
	booleans = []
	view = doc.ActiveView
	override = OverrideGraphicSettings()
	override.SetProjectionFillPatternId(ElementId(19))
	if GetMark(elid) == MarkGenerator(elid):
		override.SetProjectionFillColor(Color(0,255,0))
	elif GetMark(elid) == "":
		override.SetProjectionFillColor(Color(255,255,0))
	else:
		override.SetProjectionFillColor(Color(255,0,0))
	try:
		view.SetElementOverrides(elid, override)
	except:
		"uh-oh to be implemented"
	return booleans


def close(form):
	form.Close()




class CustomizableEvent:
    def __init__(self):
        self.function_or_method = None
        self.args = ()
        self.kwargs = {}

    def raised_method(self):
        self.function_or_method(*self.args, **self.kwargs)

    def raise_event(self, function_or_method, *args, **kwargs):
        self.args = args
        self.kwargs = kwargs
        self.function_or_method = function_or_method
        custom_event.Raise()

customizable_event = CustomizableEvent()

# Create a subclass of IExternalEventHandler
class CustomHandler(IExternalEventHandler):
    def Execute(self, application):
        try:
            customizable_event.raised_method()
        except InvalidOperationException:
            # If you don't catch this exeption Revit may crash.
            print("InvalidOperationException catched")

    # noinspection PyMethodMayBeStatic, PyPep8Naming
    def GetName(self):
        return "Execute an function or method in a IExternalHandler"


# Create an handler instance and his associated ExternalEvent
custom_handler = CustomHandler()
custom_event = ExternalEvent.Create(custom_handler)



label1 = Label();
button1 = Button();
button2 = Button();
button3 = Button();
button4 = Button();

# A simple WPF form used to call the ExternalEvent
class ModelessForm(Form):
	"""
	Simple modeless form sample
	"""
	def __init__(self):
		self.Text = 'Place Beam Tags'
		self.elementsIds = []
		self.originalMarks = []
		self.values = []
		self.Show()
	
	def addElements(self, items):
		for i in items:
			self.elementsIds.append(i)

	def acceptChanges(self, sender, e):
		if len(self.elementsIds) > 0:
			CustomizableEvent.raise_event(customizable_event, AcceptChanges, self.elementsIds) 
			#self.Close()
		else:
			TaskDialog.Show("Warning", "No beams have been selected")
	
	def undoChanges(self, sender, e):
		if len(self.elementsIds) > 0:
			CustomizableEvent.raise_event(customizable_event, DiscardChanges, self.elementsIds, self.originalMarks)
			#self.Close()
		else:
			TaskDialog.Show("Warning", "No beams have been selected")
		
	def PlaceTags(self, sender, e):
		CustomizableEvent.raise_event(customizable_event, TagAndOverride)
		
	def PlaceManyTags(self, sender, e):
		CustomizableEvent.raise_event(customizable_event, TagAndOverrideMultiple)
		
		
		
# Let's launch our beautiful and useful form !
form = ModelessForm()
form.TopMost = True


form.TopMost = True
form.Height = 160
form.Width = 380
form.StartPosition = FormStartPosition.CenterScreen


label1.Location = dPoint(110, 75);
label1.Name = "label1";
label1.Size = dSize(300, 63);
label1.TabIndex = 2;
label1.Text = "You are updating the beam tags. Click Apply" + "\n" + "Changes to update the beam Mark values.";
label1.UseCompatibleTextRendering = True;


button1.Location = dPoint(10, 20);
button1.Name = "button1";
button1.Size = dSize(88, 32);
button1.TabIndex = 0;
button1.Text = "Select one beam";
button1.UseCompatibleTextRendering = True;
button1.UseVisualStyleBackColor = True;
button1.Click += EventHandler(form.PlaceTags);


button3.Location = dPoint(10, 75);
button3.Name = "button3";
button3.Size = dSize(88, 32);
button3.TabIndex = 0;
button3.Text = "Select many beams";
button3.UseCompatibleTextRendering = True;
button3.UseVisualStyleBackColor = True;
button3.Click += EventHandler(form.PlaceManyTags);


button2.Location = dPoint(240, 20);
button2.Name = "Cancel";
button2.Size = dSize(88, 32);
button2.TabIndex = 1;
button2.Text = "Undo Changes";
button2.UseCompatibleTextRendering = True;
button2.UseVisualStyleBackColor = True;
button2.Click += EventHandler(form.undoChanges);


button4.Location = dPoint(120, 20);
button4.Name = "OK";
button4.Size = dSize(100, 32);
button4.TabIndex = 1;
button4.Text = "Apply Changes";
button4.UseCompatibleTextRendering = True;
button4.UseVisualStyleBackColor = True;
button4.Click += EventHandler(form.acceptChanges);



form.Controls.Add(button1);
form.Controls.Add(button2);
form.Controls.Add(button3);
form.Controls.Add(button4);
form.Controls.Add(label1);

#result = form.values



OUT = form.elementsIds
# ----------------------------------------
