# Dynamo graph TeklaNode.dyn (Dynamo 1.3.2.2480)

select_model_elements = DSModelElementsSelection()  # 3 picked in the model
curves = Element.Curves(select_model_elements)
byJoinedCurves = PolyCurve.ByJoinedCurves(curves)
code_block = CodeBlock { {0,1}; }
pointAtParameter = Curve.PointAtParameter(curve=byJoinedCurves, param=code_block, lacing=CrossProduct)
deconstruct = List.Deconstruct(list=pointAtParameter, lacing=Longest)
byStartPointEndPoint = Line.ByStartPointEndPoint(startPoint=deconstruct.first, endPoint=deconstruct.rest)
flatten = Flatten(byStartPointEndPoint)
code_block_2 = CodeBlock { "CHS600*10"; }
id = Element.Id(select_model_elements)
code_block_3 = CodeBlock(id=id) { "Revit Id "+id; }
overallPosition = Arup.DynaTekla.Positions.OverallPosition()
code_block_4 = CodeBlock { "Steel_Undefined"; }
teklaColumn = Arup.DynaTekla.TeklaSteel.TeklaColumn(flatten, code_block_2, code_block_3, overallPosition, code_block_4)
code_block_5 = CodeBlock { Line.ByStartPointEndPoint(Point.ByCoordinates(0,0,0),Point.ByCoordinates(1000,0,5000)); }
code_block_6 = CodeBlock { Line.ByStartPointEndPoint(Point.ByCoordinates(0,0,0),Point.ByCoordinates(5000,0,-1000)); }
code_block_7 = CodeBlock { Line.ByStartPointEndPoint(Point.ByCoordinates(0,0,0),Point.ByCoordinates(-5000,0,-1000)); }
code_block_8 = CodeBlock { Line.ByStartPointEndPoint(Point.ByCoordinates(0,0,0),Point.ByCoordinates(-1000,0,-5000)); }
code_block_9 = CodeBlock(a=code_block_5, b=code_block_6, c=code_block_7, d=code_block_8) { {a,b,c,d}; }
