# Dynamo graph TeklaselObj.dyn (Dynamo 1.3.2.2480)

selectObjects = Arup.DynaTekla.Tekla.SelectObjects()
code_block = CodeBlock(a=selectObjects) { a[0..28]; }
getReinforcement = Arup.DynaTekla.Tekla.GetReinforcement(code_block)
code_block_2 = CodeBlock(a=getReinforcement) { a[0]; }
code_block_3 = CodeBlock { 2; }
chop = List.Chop(list=code_block_2, lengths=code_block_3)
deconstruct = List.Deconstruct(list=chop@L2)
byStartPointEndPoint = Line.ByStartPointEndPoint(startPoint=deconstruct.first, endPoint=deconstruct.rest)
code_block_4 = CodeBlock(a=getReinforcement) { a[16..28]; }
byPoints = PolyCurve.ByPoints(points=code_block_4)
code_block_5 = CodeBlock { a = Point.ByCoordinates(0,0,0); b = Point.ByCoordinates(5000,0,0); Line.ByStartPointEndPoint(a,b); 250; 4000; "WalloE"; }
code_block_6 = CodeBlock { "Middle"; "Right"; "Front"; -500; -200; -300; 0; }
overallPosition = Arup.DynaTekla.Tekla.OverallPosition(code_block_6.out2, code_block_6.out1, code_block_6.out0, code_block_6.out3, code_block_6.out6, code_block_6.out6)
code_block_7 = CodeBlock { "what:"; }
panel = Arup.DynaTekla.Tekla.Panel(code_block_5.out2, code_block_5.out3, code_block_5.out4, code_block_5.out5, overallPosition, code_block_7)
