# Dynamo graph Template.dyn (Dynamo 1.3.1.1736)

# note: Select Topo

# group: Shortest Path
# note: DYNAMO VERSION: DYNAMO 1.3
# PACKAGES REQUIRED TO RUN:
# - SPRING NODES
# - LUNCHBOX

# group: CONTROL
# note: CONTROL
# note: USE:
# FOR VARIABLE CONTROL INPUTS
# SUCH AS SLIDERS

# group: INPUT
# note: INPUT
# note: USE:
# FOR FIXED INPUTS SUCH AS FILE PATHS

# group: TO REVIT
# note: TO REVIT
# note: USE:
# FOR NODE BLOCKS THAT EXPORTS GEOMETRY
# AND PARAMETERS TO REVIT

# group: MONITOR
# note: MONITOR
# note: USE:
# FOR IMPORTANT WATCH NODES

# group: ANNOTATION
# note: ANNOTATION
# note: USE:
# FOR COMMENTS AND IMPORTANT INFO

views = Views("{3D}")
code_block = CodeBlock { 1..10000..#10; }
byCoordinates = Point.ByCoordinates(x=code_block, y=code_block, lacing=CrossProduct)
flatten = Flatten(byCoordinates)
code_block_2 = CodeBlock { 1..100; }
code_block_3 = CodeBlock { "Test"; null; }
byViewPointsAndValues = Revit.AnalysisDisplay.PointAnalysisDisplay.ByViewPointsAndValues(views, flatten, code_block_2, code_block_3.out0, code_block_3.out0, code_block_3.out1)
