# Dynamo graph Test Bridge1 - Copy.dyn (Dynamo 1.3.1.1736)

# group: ALIGNMENT CURVE
select_model_element = DSModelElementSelection()

curve = CurveElement.Curve(select_model_element)
reverse = Curve.Reverse(curve)

# group: BRIDGE WIDTH
bridge_width = CodeBlock { 12300; }

# group: OFFSET
offset_from_bridge_edge = CodeBlock { 479; }

# group: VERT OFFSET
code_block = CodeBlock { 347.7; }

# group: LEFT RIGHT BARRIER NODES
sub = bridge_width - offset_from_bridge_edge
code_block_2 = CodeBlock { 2; }
div = sub / code_block_2
offset = Curve.Offset(curve=reverse, distance=div)
code_block_3 = CodeBlock { -1; }
mul = div * code_block_3
offset_2 = Curve.Offset(curve=reverse, distance=mul)
create = List.Create(offset, offset_2)
byLoft = Surface.ByLoft(create)
offset_3 = Surface.Offset(byLoft, code_block)
edges = Topology.Edges(offset_3)
curveGeometry = Edge.CurveGeometry(edges)
code_block_4 = CodeBlock { 0; }
getItemAtIndex = List.GetItemAtIndex(list=curveGeometry, index=code_block_4)
code_block_5 = CodeBlock { 2; }
getItemAtIndex_2 = List.GetItemAtIndex(list=curveGeometry, index=code_block_5)

# group: BARRIER START POINT AND SPACINGS
barrier_spacings = Custom[Barrier Spacings](curve=getItemAtIndex)  # 1. Reduces the length of the line by specified offset to the first barrier i.e 500. 2. Creates the new Curve 3. Divides the curve by the approximation of 2050
barrier_spacings_2 = Custom[Barrier Spacings](curve=getItemAtIndex_2)

# group: BARRIER POINTS AND FAMILIES
barrier_rotate = Custom[Barrier Rotate](curve=offset, Point=barrier_spacings)  # 1. Rotates Barrier
barrier_rotate_mirror = Custom[Barrier Rotate Mirror](curve=offset_2, Point=barrier_spacings_2)

string = StringInput("START AND END Z VALUES NEED TO BE THOUGHT ABOUT")
string_2 = StringInput("HOW ARE YOU GOING TO MODEL THE STEEL COMPOSITE SECTION?")
string_3 = StringInput("HOW ARE YOU GOING TO MODEL THE STEEL COMPOSITE SECTION?")
string_4 = StringInput("STICK FRAME FOR THOSE")
string_5 = StringInput("""ALIGNMENT CURVE MUST BE REPOSITIONED TO SUIT REVIT. I.E NEAR TO THE ORIGIN

PROTOCOL TO DO THIS MUST BE DISCUSSED

1. ALIGNMENT CURVE TO BE THE MATCH OF THE 3D CURVE IN CIVIL 3D""")
string_6 = StringInput("BARRIER ROTATE WILL HAVE THE BARRIER FAMILY IN THE NODE")
string_7 = StringInput("NEED TO ADJUST THIS TO SUIT WHERE THE PLATE GIRDER ENDS")
string_8 = StringInput("NEED TO ADD PROVISION SOMEWHERE FOR THE START / END Z VALUES ")

# group: DECK 1
levels = Levels("LEVEL 00")
structural_framing_types = StructuralFramingTypes("Deck2")
beamByCurve = StructuralFraming.BeamByCurve(curve=reverse, level=levels, structuralFramingType=structural_framing_types)

# group: LOCATION
code_block_6 = CodeBlock { "z Justification"; }
code_block_7 = CodeBlock { 2; }
setParameterByName = Element.SetParameterByName(element=beamByCurve, parameterName=code_block_6, value=code_block_7)

# group: SURFACES FOR BEAM PROJECTIONS
code_block_8 = CodeBlock(SolidFromRevit=setParameterByName) { SolidFromRevit; }
code_block_9 = CodeBlock(code_block_8) { SolidFaces=SolidFromRevit.Faces; }
code_block_10 = CodeBlock { 11; }
getItemAtIndex_3 = List.GetItemAtIndex(list=code_block_9, index=code_block_10)
code_block_11 = CodeBlock { 30; }
offset_4 = Surface.Offset(getItemAtIndex_3, code_block_11)
code_block_12 = CodeBlock { 12; }
getItemAtIndex_4 = List.GetItemAtIndex(list=code_block_9, index=code_block_12)
offset_5 = Surface.Offset(getItemAtIndex_4, code_block_11)

create_2 = List.Create(offset_4, offset_5)
byJoinedSurfaces = PolySurface.ByJoinedSurfaces(create_2)

# group: BEAM SPACINGS OFF CENTRE
code_block_13 = CodeBlock { 900; }
code_block_14 = CodeBlock { 1800; }
code_block_15 = CodeBlock { 1800; }

# group: BEAM SPACINGS
create_3 = List.Create(code_block_13, code_block_14, code_block_15)
getKeys = GetKeys(create_3)
code_block_16 = CodeBlock(Keys=getKeys) { 0..Keys; }
getItemAtIndex_5 = List.GetItemAtIndex(list=create_3, index=code_block_16)
sum = Math.Sum(getItemAtIndex_5)
code_block_17 = CodeBlock { -1; }
mul_2 = sum * code_block_17

offset_6 = Curve.Offset(curve=reverse, distance=sum@L1)
offset_7 = Curve.Offset(curve=reverse, distance=mul_2)

# group: PIER LOCATIONS
pier_start = CodeBlock { 23650; }
pier_end = CodeBlock { 1200; }

# group: POINT LOCATIONS TO SPLIT
create_4 = List.Create(pier_start, pier_end)
sumPlusPrevious = Custom[SumPlusPrevious](list=create_4)  # Creates a list of numbers and adds the previous index to the current.
pointAtSegmentLength = Curve.PointAtSegmentLength(curve=offset_6, segmentLength=sumPlusPrevious, lacing=CrossProduct)
reverse_2 = Curve.Reverse(offset_6)
pointAtSegmentLength_2 = Curve.PointAtSegmentLength(curve=reverse_2, segmentLength=sumPlusPrevious@L1, lacing=CrossProduct)
create_5 = List.Create(pointAtSegmentLength, pointAtSegmentLength_2)
flatten = Flatten(create_5@L1, lacing=CrossProduct)

# group: SPLIT PARAMETER
code_block_18 = CodeBlock { 0; }
getItemAtIndex_6 = List.GetItemAtIndex(list=offset_6, index=code_block_18)
code_block_19 = CodeBlock { 0; }
code_block_20 = CodeBlock { 1; }
code_block_21 = CodeBlock { 6; }
code_block_22 = CodeBlock { 7; }
create_6 = List.Create(code_block_19, code_block_20, code_block_21, code_block_22)
getItemAtIndex_7 = List.GetItemAtIndex(list=flatten, index=create_6)
parameterAtPoint = Curve.ParameterAtPoint(curve=getItemAtIndex_6, point=getItemAtIndex_7)

# group: PG CURVES
create_7 = List.Create(offset_6, offset_7)
splitByParameter = Curve.SplitByParameter(create_7, parameterAtPoint@L2)
flatten_2 = Flatten(splitByParameter@L2)
transpose = List.Transpose(flatten_2)
code_block_23 = CodeBlock { 0; }
code_block_24 = CodeBlock { 2; }
code_block_25 = CodeBlock { 4; }
create_8 = List.Create(code_block_23, code_block_24, code_block_25)
getItemAtIndex_8 = List.GetItemAtIndex(list=transpose, index=create_8)

# group: FOR CROSS BEAMS
ZAxis = Vector.ZAxis()
projectInputOnto = Surface.ProjectInputOnto(byJoinedSurfaces@L2, getItemAtIndex_8, ZAxis)
code_block_26 = CodeBlock { 2; }
flatten_3 = List.Flatten(list=projectInputOnto, amt=code_block_26)
code_block_27 = CodeBlock { 6; }
chop = List.Chop(list=flatten_3, lengths=code_block_27)

# group: CROSS FRAMING LINE WORK
code_block_28 = CodeBlock { 0.33333; }
pointAtParameter = Curve.PointAtParameter(curve=chop, param=code_block_28)
transpose_2 = List.Transpose(pointAtParameter@L2)
code_block_29 = CodeBlock { 0.66666; }
pointAtParameter_2 = Curve.PointAtParameter(curve=chop, param=code_block_29)
transpose_3 = List.Transpose(pointAtParameter_2@L2)
create_9 = List.Create(transpose_2, transpose_3)
code_block_30 = CodeBlock { 1; }
flatten_4 = List.Flatten(list=create_9, amt=code_block_30)
code_block_31 = CodeBlock { 0; }
getItemAtIndex_9 = List.GetItemAtIndex(list=flatten_4, index=code_block_31, lacing=CrossProduct)
code_block_32 = CodeBlock { 3; }
getItemAtIndex_10 = List.GetItemAtIndex(list=flatten_4, index=code_block_32, lacing=CrossProduct)
byStartPointEndPoint = Line.ByStartPointEndPoint(startPoint=getItemAtIndex_9, endPoint=getItemAtIndex_10)
code_block_33 = CodeBlock { 1; }
getItemAtIndex_11 = List.GetItemAtIndex(list=flatten_4, index=code_block_33, lacing=CrossProduct)
code_block_34 = CodeBlock { 2; }
getItemAtIndex_12 = List.GetItemAtIndex(list=flatten_4, index=code_block_34, lacing=CrossProduct)
byStartPointEndPoint_2 = Line.ByStartPointEndPoint(startPoint=getItemAtIndex_11, endPoint=getItemAtIndex_12)
code_block_35 = CodeBlock { 4; }
getItemAtIndex_13 = List.GetItemAtIndex(list=flatten_4, index=code_block_35, lacing=CrossProduct)
code_block_36 = CodeBlock { 5; }
getItemAtIndex_14 = List.GetItemAtIndex(list=flatten_4, index=code_block_36, lacing=CrossProduct)
byStartPointEndPoint_3 = Line.ByStartPointEndPoint(startPoint=getItemAtIndex_13, endPoint=getItemAtIndex_14)

# group: CROSS BEAM FRAMING
create_10 = List.Create(byStartPointEndPoint, byStartPointEndPoint_2, byStartPointEndPoint_3)
flatten_5 = Flatten(create_10)
levels_2 = Levels("LEVEL 00")
structural_framing_types_2 = StructuralFramingTypes("B1_UB254x102x25")
beamByCurve_2 = StructuralFraming.BeamByCurve(curve=flatten_5, level=levels_2, structuralFramingType=structural_framing_types_2)

string_9 = StringInput("IF BARRIERS GO THE WRONG WAY CHANGE BETWEEN POSITIVE AND NEGATIVE")

# group: PIER VERT OFFESET
pier_offset = CodeBlock { 400; }

# group: PIER CURVES FINAL
create_11 = List.Create(offset_6, offset_7)
splitByParameter_2 = Curve.SplitByParameter(create_11, parameterAtPoint@L2)
flatten_6 = Flatten(splitByParameter_2@L2)
transpose_4 = List.Transpose(flatten_6)
code_block_37 = CodeBlock { 1; }
code_block_38 = CodeBlock { 3; }
create_12 = List.Create(code_block_37, code_block_38)
getItemAtIndex_15 = List.GetItemAtIndex(list=transpose_4, index=create_12@L1)
code_block_39 = CodeBlock { 0.5; }
pointAtParameter_3 = Curve.PointAtParameter(curve=getItemAtIndex_15, param=code_block_39)
byBestFitThroughPoints = Line.ByBestFitThroughPoints(pointAtParameter_3)
code_block_40 = CodeBlock { 0.5; }
pointAtParameter_4 = Curve.PointAtParameter(curve=byBestFitThroughPoints, param=code_block_40)
normal = Curve.Normal(byBestFitThroughPoints)
translate = Geometry.Translate(geometry=pointAtParameter_4, direction=normal, distance=pier_offset)
endPoint = Curve.EndPoint(byBestFitThroughPoints)
byTwoPoints = Vector.ByTwoPoints(start=pointAtParameter_4, end=endPoint)

# group: PIER HEAD
family_types = FamilyTypes("Pier:Pier")
byPoint = FamilyInstance.ByPoint(familyType=family_types, point=translate)
YAxis = Vector.YAxis()
ZAxis_2 = Vector.ZAxis()
code_block_41 = CodeBlock { 90; }
rotate = Vector.Rotate(YAxis, ZAxis_2, code_block_41)

angleAboutAxis = Vector.AngleAboutAxis(byTwoPoints, rotate, ZAxis_2)

# group (continued): PIER HEAD
setRotation = FamilyInstance.SetRotation(familyInstance=byPoint, degree=angleAboutAxis)

code_block_42 = CodeBlock { 37; }
add = code_block + code_block_42
code_block_43 = CodeBlock { 402.6; }

# group: BARRIER RAILS WIP
code_block_44 = CodeBlock { 115.8; }
code_block_45 = CodeBlock { -1; }
mul_3 = code_block_44 * code_block_45
offset_8 = Curve.Offset(curve=offset, distance=mul_3)
offset_9 = Curve.Offset(curve=offset_2, distance=code_block_44)
create_13 = List.Create(offset_8, offset_9)
byLoft_2 = Surface.ByLoft(create_13)
code_block_46 = CodeBlock { 305; }
code_block_47 = CodeBlock { 264.4; }
create_14 = List.Create(add, code_block_46, code_block_47, code_block_43)

sumPlusPrevious_2 = Custom[SumPlusPrevious](list=create_14)

# group (continued): BARRIER RAILS WIP
offset_10 = Surface.Offset(byLoft_2, sumPlusPrevious_2)

# group: BARRIER RAILS LINEWORK
edges_2 = Topology.Edges(offset_10)
code_block_48 = CodeBlock { 1; }
dropItems = List.DropItems(list=edges_2, amount=code_block_48)
flatten_7 = Flatten(dropItems)
code_block_49 = CodeBlock { 0; }
count = Count(flatten_7)
code_block_50 = CodeBlock { 1; }
sub_2 = count - code_block_50
code_block_51 = CodeBlock { 2; }
range = Range(start=code_block_49, end=sub_2, step=code_block_51, lacing=Longest)
getItemAtIndex_16 = List.GetItemAtIndex(list=flatten_7, index=range)
curveGeometry_2 = Edge.CurveGeometry(getItemAtIndex_16)

code_block_52 = CodeBlock { 1; }
code_block_53 = CodeBlock { 3; }
code_block_54 = CodeBlock { 5; }
create_15 = List.Create(code_block_52, code_block_53, code_block_54)
getItemAtIndex_17 = List.GetItemAtIndex(list=curveGeometry_2, index=create_15)

# group: BARRIER RAILS
levels_3 = Levels("LEVEL 00")
structural_framing_types_3 = StructuralFramingTypes("Rail")
beamByCurve_3 = StructuralFraming.BeamByCurve(curve=getItemAtIndex_17, level=levels_3, structuralFramingType=structural_framing_types_3)

code_block_55 = CodeBlock { 0; }
code_block_56 = CodeBlock { 2; }
code_block_57 = CodeBlock { 4; }
create_16 = List.Create(code_block_55, code_block_56, code_block_57)
getItemAtIndex_18 = List.GetItemAtIndex(list=curveGeometry_2, index=create_16)

# group: BARRIER RAILS
levels_4 = Levels("LEVEL 00")
structural_framing_types_4 = StructuralFramingTypes("Rail")
beamByCurve_4 = StructuralFraming.BeamByCurve(curve=getItemAtIndex_18, level=levels_4, structuralFramingType=structural_framing_types_4)

code_block_58 = CodeBlock { "Cross-Section Rotation"; }
code_block_59 = CodeBlock { 180; }
setParameterByName_2 = Element.SetParameterByName(element=beamByCurve_4, parameterName=code_block_58, value=code_block_59)
code_block_60 = CodeBlock { "z Justification"; }
code_block_61 = CodeBlock { 3; }
setParameterByName_3 = Element.SetParameterByName(element=beamByCurve_4, parameterName=code_block_60, value=code_block_61)

# group: ROAD SURFACE
levels_5 = Levels("LEVEL 00")
structural_framing_types_5 = StructuralFramingTypes("Surfacing")
beamByCurve_5 = StructuralFraming.BeamByCurve(curve=reverse, level=levels_5, structuralFramingType=structural_framing_types_5)

# group: LOCATION
code_block_62 = CodeBlock { "z Justification"; }
code_block_63 = CodeBlock { 2; }
setParameterByName_4 = Element.SetParameterByName(element=beamByCurve_5, parameterName=code_block_62, value=code_block_63)

# group: SURFACE LEFT
levels_6 = Levels("LEVEL 00")
structural_framing_types_6 = StructuralFramingTypes("Surfacing Left")
beamByCurve_6 = StructuralFraming.BeamByCurve(curve=reverse, level=levels_6, structuralFramingType=structural_framing_types_6)

# group: LOCATION
code_block_64 = CodeBlock { "z Justification"; }
code_block_65 = CodeBlock { 2; }
setParameterByName_5 = Element.SetParameterByName(element=beamByCurve_6, parameterName=code_block_64, value=code_block_65)

# group: SURFACE RIGHT
levels_7 = Levels("LEVEL 00")
structural_framing_types_7 = StructuralFramingTypes("Surfacing Right")
beamByCurve_7 = StructuralFraming.BeamByCurve(curve=reverse, level=levels_7, structuralFramingType=structural_framing_types_7)

# group: LOCATION
code_block_66 = CodeBlock { "z Justification"; }
code_block_67 = CodeBlock { 2; }
setParameterByName_6 = Element.SetParameterByName(element=beamByCurve_7, parameterName=code_block_66, value=code_block_67)

# group: KERB LEFT
levels_8 = Levels("LEVEL 00")
structural_framing_types_8 = StructuralFramingTypes("Kerb Left")
beamByCurve_8 = StructuralFraming.BeamByCurve(curve=reverse, level=levels_8, structuralFramingType=structural_framing_types_8)

# group: LOCATION
code_block_68 = CodeBlock { "z Justification"; }
code_block_69 = CodeBlock { 2; }
setParameterByName_7 = Element.SetParameterByName(element=beamByCurve_8, parameterName=code_block_68, value=code_block_69)

# group: KERB RIGHT
levels_9 = Levels("LEVEL 00")
structural_framing_types_9 = StructuralFramingTypes("Kerb Right")
beamByCurve_9 = StructuralFraming.BeamByCurve(curve=reverse, level=levels_9, structuralFramingType=structural_framing_types_9)

# group: LOCATION
code_block_70 = CodeBlock { "z Justification"; }
code_block_71 = CodeBlock { 2; }
setParameterByName_8 = Element.SetParameterByName(element=beamByCurve_9, parameterName=code_block_70, value=code_block_71)

# group: CORRECT LOCATION
code_block_72 = CodeBlock { 0; }
getItemAtIndex_19 = List.GetItemAtIndex(list=chop, index=code_block_72)
code_block_73 = CodeBlock { 1; }
getItemAtIndex_20 = List.GetItemAtIndex(list=chop, index=code_block_73)
code_block_74 = CodeBlock { 2; }
getItemAtIndex_21 = List.GetItemAtIndex(list=chop, index=code_block_74)

# group: BEAM CHANGE POINT
code_block_75 = CodeBlock { 6740; }

# group: START BEAM LINES
reverse_3 = Curve.Reverse(getItemAtIndex_19)
pointAtSegmentLength_3 = Curve.PointAtSegmentLength(curve=reverse_3, segmentLength=code_block_75)
splitByPoints = Curve.SplitByPoints(curve=chop@L1, points=pointAtSegmentLength_3@L1)
transpose_5 = List.Transpose(splitByPoints)
code_block_76 = CodeBlock { 0; }
getItemAtIndex_22 = List.GetItemAtIndex(list=transpose_5, index=code_block_76)

code_block_77 = CodeBlock { 1; }
getItemAtIndex_23 = List.GetItemAtIndex(list=transpose_5, index=code_block_77)
reverse_4 = Curve.Reverse(getItemAtIndex_23)

# group: MID BEAM CHANGE POINT
code_block_78 = CodeBlock { 8225; }

pointAtSegmentLength_4 = Curve.PointAtSegmentLength(curve=getItemAtIndex_20, segmentLength=code_block_78)

# group: MID BEAM LINES
splitByPoints_2 = Curve.SplitByPoints(curve=getItemAtIndex_20@L1, points=pointAtSegmentLength_4@L1)
transpose_6 = List.Transpose(splitByPoints_2)
code_block_79 = CodeBlock { 0; }
getItemAtIndex_24 = List.GetItemAtIndex(list=transpose_6, index=code_block_79)
reverse_5 = Curve.Reverse(getItemAtIndex_20)
pointAtSegmentLength_5 = Curve.PointAtSegmentLength(curve=reverse_5, segmentLength=code_block_78)

code_block_80 = CodeBlock { 1; }
getItemAtIndex_25 = List.GetItemAtIndex(list=transpose_6, index=code_block_80)
splitByPoints_3 = Curve.SplitByPoints(curve=getItemAtIndex_25@L1, points=pointAtSegmentLength_5@L1)
transpose_7 = List.Transpose(splitByPoints_3)
code_block_81 = CodeBlock { 1; }
getItemAtIndex_26 = List.GetItemAtIndex(list=transpose_7, index=code_block_81)
reverse_6 = Curve.Reverse(getItemAtIndex_26)

# group: END BEAM LINES
pointAtSegmentLength_6 = Curve.PointAtSegmentLength(curve=getItemAtIndex_21, segmentLength=code_block_75)
splitByPoints_4 = Curve.SplitByPoints(curve=getItemAtIndex_21@L1, points=pointAtSegmentLength_6@L1)
transpose_8 = List.Transpose(splitByPoints_4)
code_block_82 = CodeBlock { 1; }
getItemAtIndex_27 = List.GetItemAtIndex(list=transpose_8, index=code_block_82)

code_block_83 = CodeBlock { 0; }
getItemAtIndex_28 = List.GetItemAtIndex(list=transpose_8, index=code_block_83)
create_17 = List.Create(reverse_4, getItemAtIndex_24, reverse_6, getItemAtIndex_28)

# group: PG TAPERING
levels_10 = Levels("LEVEL 00")
structural_framing_types_10 = StructuralFramingTypes("PG Tap")
beamByCurve_10 = StructuralFraming.BeamByCurve(curve=create_17, level=levels_10, structuralFramingType=structural_framing_types_10)

code_block_84 = CodeBlock { 0; }
getItemAtIndex_29 = List.GetItemAtIndex(list=transpose_7, index=code_block_84)
create_18 = List.Create(getItemAtIndex_22, getItemAtIndex_27, getItemAtIndex_29)

# group: PG LINES
levels_11 = Levels("LEVEL 00")
structural_framing_types_11 = StructuralFramingTypes("PG TEST")
beamByCurve_11 = StructuralFraming.BeamByCurve(curve=create_18, level=levels_11, structuralFramingType=structural_framing_types_11)

code_block_85 = CodeBlock { "Start Join Cutback"; }
code_block_86 = CodeBlock { 0; }
code_block_87 = CodeBlock { "End Join Cutback"; }
code_block_88 = CodeBlock { 0.0; }

# group: NOT ALL ELEMENTS HAVE THESE PARAMETERS
setParameterByName_9 = Element.SetParameterByName(element=beamByCurve_11, parameterName=code_block_85, value=code_block_86)
setParameterByName_10 = Element.SetParameterByName(element=beamByCurve_11, parameterName=code_block_87, value=code_block_88)
