# Dynamo graph Tributary_Area_Script 0.2.0.V2. TEST.dyn (Dynamo 1.3.3.4651)

code_block = CodeBlock()
# ---------- code_block.designscript (24 lines) ----------
/*
TRIBUTARY AREA v0.1.2

This script will take a Revit model and
grabs information from the model such as
floors, walls, columns as well as loading
information returning to excel the amount
of each load and the column along with a
cummulative sum for each floor of a column.
Script contains a CustomVoronoi Package
written to handle issues that arise
with the inbuilt voronoi script.

WRITTEN BY   -  Christopher Ho
DYNAMO VERSION  - 1.3.2.2480
PACKAGES   - Archilab, Clockwork,
      Data-Shapes
REVIT TEMPLATE  - AUS-STR
LAST UPDATED  - 21-02-2018

FUTURE IMPROVEMENTS


*/;
# ----------------------------------------
code_block_2 = CodeBlock()
# ---------- code_block_2.designscript (12 lines) ----------
/*
ASSUMPTIONS

Columns that pass through the slab are assumed
to be a prism or cylinder whose radius is a
direct line from one edge to another.

A floor will not have a sloped surface of more
than 45 degrees to the normal.

All floor surfaces are flat and not sloped
*/;
# ----------------------------------------
code_block_3 = CodeBlock()
# ---------- code_block_3.designscript (15 lines) ----------
/*
POSSIBLE ERRORS

Column top does not meet up to either
bottom of floor or not enough tolerance
has been given.

Merge Point values are not large enough.

Max distance between edge points is
too small.

Columns and or Walls are not tagged
or tagged on different parameter.
*/;
# ----------------------------------------
boolean = BoolSelector(false)
boolean_2 = BoolSelector(false)
boolean_3 = BoolSelector(false)
boolean_4 = BoolSelector(false)

# group: Get unique load types for each type of load
element_types = ElementTypes("AreaLoad")
all_elements_of_type = ElementsOfType(element_types)
code_block_4 = CodeBlock { "Load Case"; }
getParameterValueByName = Element.GetParameterValueByName(element=all_elements_of_type, parameterName=code_block_4)
uniqueItems = List.UniqueItems(getParameterValueByName)
python_script = Python(IN[0]=uniqueItems)
# ---------- python_script.python (13 lines) ----------
import clr
clr.AddReference('ProtoGeometry')
from Autodesk.DesignScript.Geometry import *

#The inputs to this node will be stored as a list in the IN variables.

output = list()

for i in IN[0]:
	output.append(UnwrapElement(i).Name)

#Assign your output to the OUT variable.
OUT = output
# ----------------------------------------
count = Count(python_script)
sequence = Sequence(amount=count, lacing=Longest)
element_types_2 = ElementTypes("LineLoad")
all_elements_of_type_2 = ElementsOfType(element_types_2)
getParameterValueByName_2 = Element.GetParameterValueByName(element=all_elements_of_type_2, parameterName=code_block_4)
uniqueItems_2 = List.UniqueItems(getParameterValueByName_2)
python_script_2 = Python(IN[0]=uniqueItems_2)  # same code as python_script
count_2 = Count(python_script_2)
sequence_2 = Sequence(amount=count_2, lacing=Longest)
element_types_3 = ElementTypes("PointLoad")
all_elements_of_type_3 = ElementsOfType(element_types_3)
getParameterValueByName_3 = Element.GetParameterValueByName(element=all_elements_of_type_3, parameterName=code_block_4)
uniqueItems_3 = List.UniqueItems(getParameterValueByName_3)
python_script_3 = Python(IN[0]=uniqueItems_3)  # same code as python_script
count_3 = Count(python_script_3)
sequence_3 = Sequence(amount=count_3, lacing=Longest)
code_block_5 = CodeBlock(AreaLoad=all_elements_of_type, LineLoad=all_elements_of_type_2, PointLoad=all_elements_of_type_3) { AreaLoad; LineLoad; PointLoad; }

boolean_5 = BoolSelector(true)
boolean_6 = BoolSelector(true)
boolean_7 = BoolSelector(true)
boolean_8 = BoolSelector(true)

# group: Get unique Levels which floors exist on
categories = Categories("Floors")
all_elements_of_category = ElementsOfCategory(categories)
code_block_6 = CodeBlock { "Level"; }
getParameterValueByName_4 = Element.GetParameterValueByName(element=all_elements_of_category, parameterName=code_block_6)
uniqueItems_4 = List.UniqueItems(getParameterValueByName_4)
code_block_7 = CodeBlock(levels=uniqueItems_4) { levels.Elevation; }
sortIndexByValue = SortIndexByValue(code_block_7)
getItemAtIndex = List.GetItemAtIndex(list=uniqueItems_4@L2, index=sortIndexByValue)
flatten = Flatten(getItemAtIndex)
count_4 = List.Count(flatten)

boolean_9 = BoolSelector(true)

# group: Form
code_block_8 = CodeBlock { "Load Takedown"; "Begin Calculation"; "Cancel"; }
file_path = Filename("Resource\A_Image_Icon.ico")
code_block_9 = CodeBlock { "Excel Output"; "The following inputs take information regarding the excel file for which output is sent to."; }
ui_textnote_data = Custom[UI.TextNote Data](Title=code_block_9.out0, TextNote=code_block_9.out1)  # Create Data for TextNote input in UI.MultipleInputForm ++ . Check out www.data-shapes.net for more informations
code_block_10 = CodeBlock { "Excel Output File Path:"; "Find Excel File"; }
file_path_2 = Filename(".\TributaryOutput.xlsx")
ui_filepath_data = Custom[UI.FilePath Data](InputName=code_block_10.out0, DefaulPath=file_path_2, ButtonText=code_block_10.out1)  # Create filepath input for UI.MultipleInputForm ++ . Check out www.data-shapes.net for more infos !
code_block_11 = CodeBlock { "Sheet Name:"; "LoadTakedown"; }
ui_textbox_data = Custom[UI.TextBox Data](InputName=code_block_11.out0, DefaultText=code_block_11.out1, IsNumberEntry=boolean)  # Create Data for TextBox input in UI.MultipleInputForm ++ . Check out www.data-shapes.net for more informations
code_block_12 = CodeBlock { "Overwrite Existing?"; false; }
ui_boolean_input = Custom[UI.Boolean input](InputName=code_block_12.out0, DefaultValue=code_block_12.out1)  # Creates a boolean input for UI.MultipleInputForm ++ . Check out www.data-shapes.net for more infos!
code_block_13 = CodeBlock()
# ---------- code_block_13.designscript (2 lines) ----------
"Template Parameters";
"Parameter names specific to the template being used, this may need to be changed according to region as it seems we all have different templates";
# ----------------------------------------
ui_textnote_data_2 = Custom[UI.TextNote Data](Title=code_block_13.out0, TextNote=code_block_13.out1)
code_block_14 = CodeBlock { "Density Parameter:"; "Specification_Material_Density"; }
ui_textbox_data_2 = Custom[UI.TextBox Data](InputName=code_block_14.out0, DefaultText=code_block_14.out1, IsNumberEntry=boolean_2)
code_block_15 = CodeBlock { "Column Unique ID Parameter:"; "Mark"; }
ui_textbox_data_3 = Custom[UI.TextBox Data](InputName=code_block_15.out0, DefaultText=code_block_15.out1, IsNumberEntry=boolean_3)
code_block_16 = CodeBlock { "Wall Unique ID Parameter:"; "Mark"; }
ui_textbox_data_4 = Custom[UI.TextBox Data](InputName=code_block_16.out0, DefaultText=code_block_16.out1, IsNumberEntry=boolean_4)
code_block_17 = CodeBlock()
# ---------- code_block_17.designscript (2 lines) ----------
"Calculation Parameters";
"Select the caulation limits for which you want results for. It is not recommended to use this for calculating Line and Point loads unless the loads are close to a column or wall. Facade Load Case will not be considered for normal loading and will be separated.";
# ----------------------------------------
ui_textnote_data_3 = Custom[UI.TextNote Data](Title=code_block_17.out0, TextNote=code_block_17.out1)
code_block_18 = CodeBlock { "Area Loads:"; }
code_block_19 = CodeBlock(x=count) { x!=0?x*25+25:25; }
code_block_20 = CodeBlock { false; }
ui_listview_data = Custom[UI.Listview Data](InputName=code_block_18, Keys=python_script, Values=sequence, Height_optionnal=code_block_19, SortItems_optionnal=code_block_20, ShowId_optionnal=boolean_5)  # Create data for ListView input in UI.MultiInputForm ++ . Check out www.data-shapes.net for more infos.
code_block_21 = CodeBlock { "Internal Load:"; }
code_block_22 = CodeBlock(x=count_2) { x!=0?x*25+25:25; }
code_block_23 = CodeBlock { false; }
ui_listview_data_2 = Custom[UI.Listview Data](InputName=code_block_21, Keys=python_script_2, Values=sequence_2, Height_optionnal=code_block_22, SortItems_optionnal=code_block_23, ShowId_optionnal=boolean_6)
code_block_24 = CodeBlock { "Facade Load:"; }
code_block_25 = CodeBlock(x=count_2) { x!=0?x*25+25:25; }
code_block_26 = CodeBlock { false; }
ui_listview_data_3 = Custom[UI.Listview Data](InputName=code_block_24, Keys=python_script_2, Values=sequence_2, Height_optionnal=code_block_25, SortItems_optionnal=code_block_26, ShowId_optionnal=boolean_7)
code_block_27 = CodeBlock { "Point Load:"; }
code_block_28 = CodeBlock(x=count_3) { x!=0?x*25+25:25; }
code_block_29 = CodeBlock { false; }
ui_listview_data_4 = Custom[UI.Listview Data](InputName=code_block_27, Keys=python_script_3, Values=sequence_3, Height_optionnal=code_block_28, SortItems_optionnal=code_block_29, ShowId_optionnal=boolean_8)
code_block_30 = CodeBlock { "Levels to Consider"; }
code_block_31 = CodeBlock(flatten) { LevelEle.Name; }
sequence_4 = Sequence(amount=count_4, lacing=Longest)
code_block_32 = CodeBlock(x=count_4) { (x*25)>200?200:x*25+25; }
ui_listview_data_5 = Custom[UI.Listview Data](InputName=code_block_30, Keys=code_block_31, Values=sequence_4, Height_optionnal=code_block_32, ShowId_optionnal=boolean_9)
code_block_33 = CodeBlock { "Calculation Resolution"; "Select the Resolution you want to calculate at."; }
ui_textnote_data_4 = Custom[UI.TextNote Data](Title=code_block_33.out0, TextNote=code_block_33.out1)
code_block_34 = CodeBlock { "Edge Resolution:"; 0; 1000; 350; 10; }
slider = Custom[UI.Slider](InputName=code_block_34.out0, Minimum=code_block_34.out1, Maximum=code_block_34.out2, Default_Value=code_block_34.out3, Step=code_block_34.out4)  # Creates slider input for UI.MultipleInputForm ++ . Set the step to decimal value if you want a double slider, or to a integer value if you want an integer slider.
code_block_35 = CodeBlock { "Voronoi Collapse:"; 0; 15; 7.5; 0.1; }
slider_2 = Custom[UI.Slider](InputName=code_block_35.out0, Minimum=code_block_35.out1, Maximum=code_block_35.out2, Default_Value=code_block_35.out3, Step=code_block_35.out4)
code_block_36 = CodeBlock { "Floor Tolerance:"; 0; 500; 20; 10; }
slider_3 = Custom[UI.Slider](InputName=code_block_36.out0, Minimum=code_block_36.out1, Maximum=code_block_36.out2, Default_Value=code_block_36.out3, Step=code_block_36.out4)
code_block_37 = CodeBlock { "Output Resolution"; "Set output details."; }
ui_textnote_data_5 = Custom[UI.TextNote Data](Title=code_block_37.out0, TextNote=code_block_37.out1)
code_block_38 = CodeBlock { "Output Rounding:"; 0; 10; 2; 1; }
slider_4 = Custom[UI.Slider](InputName=code_block_38.out0, Minimum=code_block_38.out1, Maximum=code_block_38.out2, Default_Value=code_block_38.out3, Step=code_block_38.out4)
code_block_39 = CodeBlock { "Invert Force Values?"; false; }
ui_boolean_input_2 = Custom[UI.Boolean input](InputName=code_block_39.out0, DefaultValue=code_block_39.out1)
create = List.Create(ui_textnote_data, ui_filepath_data, ui_textbox_data, ui_boolean_input, ui_textnote_data_2, ui_textbox_data_2, ui_textbox_data_3, ui_textbox_data_4, ui_textnote_data_3, ui_listview_data, ui_listview_data_2, ui_listview_data_3, ui_listview_data_4, ui_listview_data_5, ui_textnote_data_4, slider, slider_2, slider_3, ui_textnote_data_5, slider_4, ui_boolean_input_2)
boolean_10 = BoolSelector(true)
code_block_40 = CodeBlock { 1000; 500; }
ui_multipleinputform = Custom[UI.MultipleInputForm ++](Description_optional=code_block_8.out0, Logo_optional=file_path, ButtonText_optional=code_block_8.out1, Inputs=create, Toggle=boolean_10, CancelButtonText_optional=code_block_8.out2, MaxHeight_optional=code_block_40.out0, Width_optional=code_block_40.out1)  # Create a form with multiple inputs. see www.data-shapes.net for tutorials and infos!

# group: Duplicate Revit Document to prevent any mishaps such as cancellation or crashes damaging original model.
code_block_41 = CodeBlock { '\'; }
current = Document.Current()
filePath = Document.FilePath(current)
split = String.Split(filePath, code_block_41)
code_block_42 = CodeBlock(x=split) { List.Count(x)-1; }
code_block_43 = CodeBlock { "Tributary Calculation Model.rvt"; }
replaceItemAtIndex = List.ReplaceItemAtIndex(list=split, index=code_block_42, item=code_block_43)
join = String.Join(code_block_41, replaceItemAtIndex)
code_block_44 = CodeBlock(x=ui_multipleinputform.Was_Cancelled, path=join) { x?null:path; }
saveAs = Custom[Document.SaveAs](filePath=code_block_44)  # Saves the active Revit document under the given name.
code_block_45 = CodeBlock(x=saveAs, path=code_block_44)
# ---------- code_block_45.designscript (3 lines) ----------
x;
//pause until file is written, hence the need for the success as input
path;
# ----------------------------------------
code_block_46 = CodeBlock { true; }

openDocumentFile = Rhythm.Revit.Application.Application.OpenDocumentFile(code_block_45.path, arg2=code_block_46)

# group (continued): Duplicate Revit Document to prevent any mishaps such as cancellation or crashes damaging original model.
flatten_2 = Flatten(openDocumentFile)

# group: Extract Variables from UserInput
code_block_47 = CodeBlock(inputs=ui_multipleinputform.User_Inputs)
# ---------- code_block_47.designscript (16 lines) ----------
OutputFile = inputs[0];
Sheetname = inputs[1];
Overwrite = inputs[2];
DensityParam = inputs[3];
ColID = inputs[4];
WallID = inputs[5];
AreaLoad = inputs[6];
Lineload = inputs[7];
FacadeCases = inputs[8];
PointLoad = inputs[9];
Floors = inputs[10];
EdgeRes = inputs[11];
VCol = inputs[12];
FloorTol = inputs[13];
Rounding = inputs[14];
InvertForce = inputs[15];
# ----------------------------------------
getItemAtIndex_2 = List.GetItemAtIndex(list=flatten, index=code_block_47.Floors)
count_5 = List.Count(getItemAtIndex_2)
python_script_4 = Python(IN[0]=count_5, IN[1]=getItemAtIndex_2, IN[2]=flatten)
# ---------- python_script_4.python (8 lines) ----------
import clr
clr.AddReference('ProtoGeometry')
from Autodesk.DesignScript.Geometry import *
#The inputs to this node will be stored as a list in the IN variables.
if IN[0] > 0:
	OUT = IN[1]
else:
	OUT = IN[2]
# ----------------------------------------
getItemAtIndex_3 = List.GetItemAtIndex(list=uniqueItems, index=code_block_47.AreaLoad)
setDifference = SetDifference(code_block_47.Lineload, code_block_47.FacadeCases)
getItemAtIndex_4 = List.GetItemAtIndex(list=uniqueItems_2, index=setDifference)
getItemAtIndex_5 = List.GetItemAtIndex(list=uniqueItems_2, index=code_block_47.FacadeCases)
getItemAtIndex_6 = List.GetItemAtIndex(list=uniqueItems_3, index=code_block_47.PointLoad)
code_block_48 = CodeBlock(AreaCase=getItemAtIndex_3, LineCase=getItemAtIndex_4, FacadeCase=getItemAtIndex_5, PointCase=getItemAtIndex_6) { AreaCase; LineCase; FacadeCase; PointCase; }
code_block_49 = CodeBlock(x=code_block_47.InvertForce) { x?-1:1; }

# group: Grab all floors and only get floors that are on the levels of interest and structural
getFloors = Python(IN[0]=flatten_2)
# ---------- getFloors.python (27 lines) ----------
import clr

clr.AddReference('RevitAPI')
from Autodesk.Revit.DB import *
from Autodesk.Revit.DB.Structure import *

clr.AddReference('RevitAPIUI')
from Autodesk.Revit.UI import *

clr.AddReference('System')
from System.Collections.Generic import List

clr.AddReference('RevitNodes')
import Revit
clr.ImportExtensions(Revit.GeometryConversion)
clr.ImportExtensions(Revit.Elements)

clr.AddReference('RevitServices')
import RevitServices
from RevitServices.Persistence import DocumentManager
from RevitServices.Transactions import TransactionManager

doc = IN[0][0]

Floors = FilteredElementCollector(doc).OfCategory(BuiltInCategory.OST_Floors).WhereElementIsNotElementType().ToElements()

OUT = Floors
# ----------------------------------------
code_block_50 = CodeBlock { "Level"; }
getParameterValueByName_5 = Element.GetParameterValueByName(element=getFloors, parameterName=code_block_50)
containsItem = List.ContainsItem(list=python_script_4, item=getParameterValueByName_5@@L1)
filterByBoolMask = List.FilterByBoolMask(list=getFloors, mask=containsItem)
code_block_51 = CodeBlock { "Structural"; }
getParameterValueByName_6 = Element.GetParameterValueByName(element=filterByBoolMask.in, parameterName=code_block_51)
code_block_52 = CodeBlock(x=getParameterValueByName_6) { x == ""?false:x>=1; }
filterByBoolMask_2 = List.FilterByBoolMask(list=filterByBoolMask.in, mask=code_block_52)

# group: Grab Columns that intersect floors of interest
getStructuralColumns = Python(IN[0]=flatten_2, IN[1]=filterByBoolMask_2.in)
# ---------- getStructuralColumns.python (32 lines) ----------
import clr

clr.AddReference('RevitAPI')
from Autodesk.Revit.DB import *
from Autodesk.Revit.DB.Structure import *

clr.AddReference('RevitAPIUI')
from Autodesk.Revit.UI import *

clr.AddReference('System')
from System.Collections.Generic import List

clr.AddReference('RevitNodes')
import Revit
clr.ImportExtensions(Revit.GeometryConversion)
clr.ImportExtensions(Revit.Elements)

clr.AddReference('RevitServices')
import RevitServices
from RevitServices.Persistence import DocumentManager
from RevitServices.Transactions import TransactionManager

Columns = []
doc = IN[0][0]

for Floor in UnwrapElement(IN[1]):
	bb = Floor.get_BoundingBox(doc.ActiveView)
	outline = Outline(bb.Min, bb.Max)
	filter = BoundingBoxIntersectsFilter(outline)
	Columns.Add(FilteredElementCollector(doc).OfCategory(BuiltInCategory.OST_StructuralColumns).WhereElementIsNotElementType().WherePasses(filter).ToElements())

OUT = Columns
# ----------------------------------------
flatten_3 = Flatten(getStructuralColumns)
uniqueItems_5 = List.UniqueItems(flatten_3)
getParameterValueByName_7 = Element.GetParameterValueByName(element=uniqueItems_5, parameterName=code_block_47.ColID)
geometry = Element.Geometry(uniqueItems_5)

# group: Grab Walls that intersect floors of interest
getWalls = Python(IN[0]=flatten_2, IN[1]=filterByBoolMask_2.in)
# ---------- getWalls.python (32 lines) ----------
import clr

clr.AddReference('RevitAPI')
from Autodesk.Revit.DB import *
from Autodesk.Revit.DB.Structure import *

clr.AddReference('RevitAPIUI')
from Autodesk.Revit.UI import *

clr.AddReference('System')
from System.Collections.Generic import List

clr.AddReference('RevitNodes')
import Revit
clr.ImportExtensions(Revit.GeometryConversion)
clr.ImportExtensions(Revit.Elements)

clr.AddReference('RevitServices')
import RevitServices
from RevitServices.Persistence import DocumentManager
from RevitServices.Transactions import TransactionManager

Walls = []
doc = IN[0][0]

for Floor in UnwrapElement(IN[1]):
	bb = Floor.get_BoundingBox(doc.ActiveView)
	outline = Outline(bb.Min, bb.Max)
	filter = BoundingBoxIntersectsFilter(outline)
	Walls.Add(FilteredElementCollector(doc).OfCategory(BuiltInCategory.OST_Walls).WhereElementIsNotElementType().WherePasses(filter).ToElements())

OUT = Walls
# ----------------------------------------
flatten_4 = Flatten(getWalls)
uniqueItems_6 = List.UniqueItems(flatten_4)
code_block_53 = CodeBlock { "Structural"; }
getParameterValueByName_8 = Element.GetParameterValueByName(element=uniqueItems_6, parameterName=code_block_53)
code_block_54 = CodeBlock(x=getParameterValueByName_8) { x>=1; }
filterByBoolMask_3 = List.FilterByBoolMask(list=uniqueItems_6, mask=code_block_54)
getParameterValueByName_9 = Element.GetParameterValueByName(element=filterByBoolMask_3.in, parameterName=code_block_47.WallID)
geometry_2 = Element.Geometry(filterByBoolMask_3.in)

# group: Tag Untagged Vertical Element
code_block_55 = CodeBlock { "Untagged Column - "; }
id_checker = Custom[ID Checker](ElementID=getParameterValueByName_7, Tagging=code_block_55)  # Checks whether Mark is filled it and adds an ID for the unnamed elements.
code_block_56 = CodeBlock { "Untagged Wall - "; }
id_checker_2 = Custom[ID Checker](ElementID=getParameterValueByName_9, Tagging=code_block_56)
code_block_57 = CodeBlock(ColumnID=id_checker, WallID=id_checker_2) { ColumnID; WallID; }

# group: Puts tagging back into Revit
setParameterByName = Element.SetParameterByName(element=uniqueItems_5, parameterName=code_block_47.ColID, value=code_block_57.ColumnID)
setParameterByName_2 = Element.SetParameterByName(element=filterByBoolMask_3.in, parameterName=code_block_47.WallID, value=code_block_57.WallID)

# group: Create bounding box
code_block_58 = CodeBlock { -1; 2; 0.1; }
range = Range(start=code_block_58.out0, end=code_block_58.out1, step=code_block_58.out2, lacing=Longest)
firstItem = List.FirstItem(range)
byCoordinates = UV.ByCoordinates(range, firstItem)
lastItem = List.LastItem(range)
byCoordinates_2 = UV.ByCoordinates(lastItem, range)
byCoordinates_3 = UV.ByCoordinates(firstItem, range)
byCoordinates_4 = UV.ByCoordinates(range, lastItem)
join_2 = List.Join(byCoordinates, byCoordinates_2, byCoordinates_3, byCoordinates_4)

# group: Group and Sort floors by level
getParameterValueByName_10 = Element.GetParameterValueByName(element=filterByBoolMask_2.in, parameterName=code_block_50)
groupByKey = List.GroupByKey(list=filterByBoolMask_2.in, keys=getParameterValueByName_10)
code_block_59 = CodeBlock(levels=groupByKey.unique_keys) { levels.Elevation; }
sortIndexByValue_2 = SortIndexByValue(code_block_59)
getItemAtIndex_7 = List.GetItemAtIndex(list=groupByKey.groups@@L3, index=sortIndexByValue_2)
code_block_60 = CodeBlock { 1; }
flatten_5 = List.Flatten(list=getItemAtIndex_7, amt=code_block_60)
getItemAtIndex_8 = List.GetItemAtIndex(list=groupByKey.unique_keys@L2, index=sortIndexByValue_2@@L1, lacing=Longest)

# group: Get Floor Solids
geometry_3 = Element.Geometry(flatten_5)
explodeSolid = CustomVoronoi.SolidGrouping.ExplodeSolid(geometry_3)
flatten_6 = Flatten(explodeSolid@@L4)
solidGroup = CustomVoronoi.SolidGrouping.SolidGroup(flatten_6@@L2)
getItemAtIndex_9 = List.GetItemAtIndex(list=flatten_6@L2, index=solidGroup@@L3)
flatten_7 = Flatten(flatten_5)
count_6 = List.Count(explodeSolid@@L2)

# group: Grab Beams that intersect floor of interest
getStructuralBeams = Python(IN[0]=flatten_2, IN[1]=filterByBoolMask_2.in)
# ---------- getStructuralBeams.python (32 lines) ----------
import clr

clr.AddReference('RevitAPI')
from Autodesk.Revit.DB import *
from Autodesk.Revit.DB.Structure import *

clr.AddReference('RevitAPIUI')
from Autodesk.Revit.UI import *

clr.AddReference('System')
from System.Collections.Generic import List

clr.AddReference('RevitNodes')
import Revit
clr.ImportExtensions(Revit.GeometryConversion)
clr.ImportExtensions(Revit.Elements)

clr.AddReference('RevitServices')
import RevitServices
from RevitServices.Persistence import DocumentManager
from RevitServices.Transactions import TransactionManager

Beams = []
doc = IN[0][0]

for Floor in UnwrapElement(IN[1]):
	bb = Floor.get_BoundingBox(doc.ActiveView)
	outline = Outline(bb.Min, bb.Max)
	filter = BoundingBoxIntersectsFilter(outline)
	Beams.Add(FilteredElementCollector(doc).OfCategory(BuiltInCategory.OST_StructuralFraming).WhereElementIsNotElementType().WherePasses(filter).ToElements())

OUT = Beams
# ----------------------------------------
flatten_8 = Flatten(getStructuralBeams)
uniqueItems_7 = List.UniqueItems(flatten_8)
geometry_4 = Element.Geometry(uniqueItems_7)

code_block_61 = CodeBlock(FloorAsIs=getItemAtIndex_9, BeamsAsIs=geometry_4, ColumnAsIs=geometry, WallAsIs=geometry_2, FloorElement=flatten_5, FloorElementF=flatten_7, BeamElement=uniqueItems_7)
# ---------- code_block_61.designscript (8 lines) ----------
//Gate to wait for geometry to be imported before modifying joints.
FloorAsIs;
BeamsAsIs;
ColumnAsIs;
WallAsIs;
FloorElement;
FloorElementF;
BeamElement;
# ----------------------------------------

# group: Group Element and ID
create_2 = List.Create(uniqueItems_5, filterByBoolMask_3.in)
flatten_9 = Flatten(create_2)
create_3 = List.Create(code_block_57.ColumnID, code_block_57.WallID)
flatten_10 = Flatten(create_3)

# group: Unjoin Beams
python_script_5 = Python(IN[0]=code_block_61.FloorElementF, IN[1]=code_block_61.BeamElement)
# ---------- python_script_5.python (39 lines) ----------
import clr

clr.AddReference('RevitAPI')
from Autodesk.Revit.DB import *
from Autodesk.Revit.DB.Structure import *

clr.AddReference('RevitAPIUI')
from Autodesk.Revit.UI import *

clr.AddReference('System')
from System.Collections.Generic import List

clr.AddReference('RevitNodes')
import Revit
clr.ImportExtensions(Revit.GeometryConversion)
clr.ImportExtensions(Revit.Elements)

clr.AddReference('RevitServices')
import RevitServices
from RevitServices.Persistence import DocumentManager
from RevitServices.Transactions import TransactionManager

doc = DocumentManager.Instance.CurrentDBDocument

slab = UnwrapElement(IN[0])
beam = UnwrapElement(IN[1])

#Do some action in a Transaction
TransactionManager.Instance.EnsureInTransaction(doc)

for Slab in slab:
	for Beam in beam:
		areJoined = JoinGeometryUtils.AreElementsJoined(doc,Slab,Beam)
		if areJoined:
			JoinGeometryUtils.UnjoinGeometry(doc,Beam,Slab)

TransactionManager.Instance.TransactionTaskDone()

OUT = "Unjoined"
# ----------------------------------------
python_script_6 = Python(IN[0]=code_block_61.BeamElement)
# ---------- python_script_6.python (38 lines) ----------
import clr

clr.AddReference('RevitAPI')
from Autodesk.Revit.DB import *
from Autodesk.Revit.DB.Structure import *

clr.AddReference('RevitAPIUI')
from Autodesk.Revit.UI import *

clr.AddReference('System')
from System.Collections.Generic import List

clr.AddReference('RevitNodes')
import Revit
clr.ImportExtensions(Revit.GeometryConversion)
clr.ImportExtensions(Revit.Elements)

clr.AddReference('RevitServices')
import RevitServices
from RevitServices.Persistence import DocumentManager
from RevitServices.Transactions import TransactionManager

doc = DocumentManager.Instance.CurrentDBDocument

slab = UnwrapElement(IN[0])

#Do some action in a Transaction
TransactionManager.Instance.EnsureInTransaction(doc)
outlist = []
for index in xrange(0, len(slab)-2):
	for other in xrange(index+1,len(slab)-1):
		areJoined = JoinGeometryUtils.AreElementsJoined(doc,slab[index],slab[other])
		if areJoined:
			floorIsCut = JoinGeometryUtils.UnjoinGeometry(doc,slab[index],slab[other])

TransactionManager.Instance.TransactionTaskDone()

OUT = "Sliced"
# ----------------------------------------
python_script_7 = Python(IN[0]=code_block_61.BeamElement, IN[1]=flatten_9)
# ---------- python_script_7.python (39 lines) ----------
import clr

clr.AddReference('RevitAPI')
from Autodesk.Revit.DB import *
from Autodesk.Revit.DB.Structure import *

clr.AddReference('RevitAPIUI')
from Autodesk.Revit.UI import *

clr.AddReference('System')
from System.Collections.Generic import List

clr.AddReference('RevitNodes')
import Revit
clr.ImportExtensions(Revit.GeometryConversion)
clr.ImportExtensions(Revit.Elements)

clr.AddReference('RevitServices')
import RevitServices
from RevitServices.Persistence import DocumentManager
from RevitServices.Transactions import TransactionManager

doc = DocumentManager.Instance.CurrentDBDocument

beam = UnwrapElement(IN[0])
column = UnwrapElement(IN[1])

#Do some action in a Transaction
TransactionManager.Instance.EnsureInTransaction(doc)

for Column in column:
	for Beam in beam:
		areJoined = JoinGeometryUtils.AreElementsJoined(doc,Column,Beam)
		if areJoined:
			JoinGeometryUtils.UnjoinGeometry(doc,Beam,Column)

TransactionManager.Instance.TransactionTaskDone()

OUT = "Unjoined"
# ----------------------------------------

code_block_62 = CodeBlock(FloorElement=code_block_61.FloorElement, FloorElementF=code_block_61.FloorElementF, BeamElement=code_block_61.BeamElement, Beam_Slab_Unjoined=python_script_5, Beam_Beam_Unjoined=python_script_6, Beam_ColumnWall_Unjoined=python_script_7) { FloorElement; FloorElementF; BeamElement; Beam_Slab_Unjoined; Beam_Beam_Unjoined; Beam_ColumnWall_Unjoined; }
geometry_5 = Element.Geometry(code_block_62.BeamElement)

# group: Floor Cuts all Geo
python_script_8 = Python(IN[0]=code_block_62.FloorElementF, IN[1]=flatten_9)
# ---------- python_script_8.python (51 lines) ----------
import clr

clr.AddReference('RevitAPI')
from Autodesk.Revit.DB import *
from Autodesk.Revit.DB.Structure import *

clr.AddReference('RevitAPIUI')
from Autodesk.Revit.UI import *

clr.AddReference('System')
from System.Collections.Generic import List

clr.AddReference('RevitNodes')
import Revit
clr.ImportExtensions(Revit.GeometryConversion)
clr.ImportExtensions(Revit.Elements)

clr.AddReference('RevitServices')
import RevitServices
from RevitServices.Persistence import DocumentManager
from RevitServices.Transactions import TransactionManager

doc = DocumentManager.Instance.CurrentDBDocument

slab = UnwrapElement(IN[0])
column = UnwrapElement(IN[1])

#Do some action in a Transaction
TransactionManager.Instance.EnsureInTransaction(doc)
outlist = []
for Slab in slab:
	for Column in column:
		areJoined = JoinGeometryUtils.AreElementsJoined(doc,Slab,Column)
		if areJoined:
			floorIsCut = JoinGeometryUtils.IsCuttingElementInJoin(doc,Column,Slab)
			if floorIsCut:
				JoinGeometryUtils.SwitchJoinOrder(doc,Slab,Column)
		else:
			try:
				JoinGeometryUtils.JoinGeometry(doc,Column,Slab)
				areJoined = JoinGeometryUtils.AreElementsJoined(doc,Slab,Column)
				if areJoined:
					floorIsCut = JoinGeometryUtils.IsCuttingElementInJoin(doc,Column,Slab)
					if floorIsCut:
						JoinGeometryUtils.SwitchJoinOrder(doc,Slab,Column)
			except:
				outlist.Add("Error Found")

TransactionManager.Instance.TransactionTaskDone()

OUT = "Sliced"
# ----------------------------------------

code_block_63 = CodeBlock(IdealBeam=geometry_5, FloorElement=code_block_62.FloorElement, VerticalElement=flatten_9, FloorCutColumnWall=python_script_8) { IdealBeam; FloorElement; VerticalElement; FloorCutColumnWall; }
geometry_6 = Element.Geometry(code_block_63.FloorElement)
explodeSolid_2 = CustomVoronoi.SolidGrouping.ExplodeSolid(geometry_6)
flatten_11 = Flatten(explodeSolid_2@@L4)
solidGroupS = CustomVoronoi.SolidGrouping.SolidGroupS(flatten_11)

# group: Get Floor Surface
downwardSurface = Tributary_Area.GeometryDeconstruct.DownwardSurface(solidGroupS)
flatten_12 = Flatten(downwardSurface@@L3)
regionUnion = Tributary_Area.GeometryIntersect.RegionUnion(flatten_12@@L2)

code_block_64 = CodeBlock(x=regionUnion) { x[0][0]; }

# group: Find max and min height of each joined floor
boundingBox = Geometry.BoundingBox(solidGroupS@@L2)
maxPoint = BoundingBox.MaxPoint(boundingBox)
Z = Point.Z(maxPoint)
maximumItem = List.MaximumItem(Z@@L2)
minPoint = BoundingBox.MinPoint(boundingBox)
Z_2 = Point.Z(minPoint)
minimumItem = List.MinimumItem(Z_2@@L2)
code_block_65 = CodeBlock(x=minimumItem) { x-1000; }
code_block_66 = CodeBlock(x=minimumItem, y=code_block_47.FloorTol) { x-y; }
code_block_67 = CodeBlock(Maxht=maximumItem, Minht=code_block_65, MinAccept=code_block_66) { Maxht; Minht; MinAccept; }

geometry_7 = Element.Geometry(code_block_63.VerticalElement)
upwardSurface = Tributary_Area.GeometryDeconstruct.UpwardSurface(geometry_7)
flatten_13 = Flatten(upwardSurface@@L3)

# group: Map Points of column and walls to floor
flatten_14 = Flatten()  # unwired: arg0
mappedPoint = Tributary_Area.EdgePoint.MappedPoint(flatten_10@L1, flatten_13@@L2, code_block_47.EdgeRes)
flatten_15 = Flatten(code_block_67.Maxht)
flatten_16 = Flatten(code_block_67.MinAccept)
floorPoint = Tributary_Area.EdgePoint.FloorPoint(mappedPoint, arg3=flatten_15, arg4=flatten_16)  # unwired: arg1, arg2

# group: Merge all points and clean up values
addItemToEnd = List.AddItemToEnd(item=join_2, list=flatten_14@@L2)
flatten_17 = Flatten(addItemToEnd@@L3)
removeNulls = Lists.Manage.RemoveNulls(flatten_17)
uniqueItems_8 = List.UniqueItems(flatten_17@@L2)
code_block_68 = CodeBlock(UVPts=uniqueItems_8) { UVPts; }

code_block_69 = CodeBlock(x=code_block_68) { x[0][0]; }

# group: Fortune's Voronoi
code_block_70 = CodeBlock(UVPts=code_block_69, FloorSurface=code_block_64, MergeDistance=code_block_47.VCol) { UVPts; FloorSurface; MergeDistance; }
voronoiFortuneUV = CustomVoronoi.VoronoiCustom.VoronoiFortuneUV(code_block_70.UVPts@L2, code_block_70.FloorSurface@@L1)
lineFix = CustomVoronoi.FixVertices.LineFix(voronoiFortuneUV, code_block_70.MergeDistance)
buildSurfaceInter = Tributary_Area.GeometryInput.BuildSurfaceInter(lineFix@@L2, code_block_70.FloorSurface@L1)

groupByKey_2 = List.GroupByKey(keys=floorPoint@@L2)  # unwired: list
flatten_18 = Flatten(groupByKey_2.groups@@L3)

# group (continued): Map Points of column and walls to floor
checkSurf = Tributary_Area.EdgePoint.CheckSurf(groupByKey_2.unique_keys@L2, flatten_18@L3, regionUnion@@L1)

# group: Get Level names
code_block_71 = CodeBlock { 1; }
chop = List.Chop(list=getItemAtIndex_8@L2, lengths=code_block_71)
code_block_72 = CodeBlock(levels=chop) { levels.Name; }
count_7 = List.Count(getItemAtIndex_9@@L3)
ofRepeatedItem = List.OfRepeatedItem(item=code_block_72@@L1, amount=count_7@L1)
flatten_19 = Flatten(ofRepeatedItem@@L3)

# group: Get Density
code_block_73 = CodeBlock { "Type"; "Structural Material"; }
getParameterValueByName_11 = Element.GetParameterValueByName(element=flatten_5, parameterName=code_block_73.out0)
getParameterValueByName_12 = Element.GetParameterValueByName(element=getParameterValueByName_11, parameterName=code_block_47.DensityParam)
getParameterValueByName_13 = Element.GetParameterValueByName(element=getParameterValueByName_11, parameterName=code_block_73.out1)
get_material_density = Python(IN[0]=getParameterValueByName_13)
# ---------- get_material_density.python (33 lines) ----------
#Assign your output to the OUT variable.
import clr

clr.AddReference("RevitAPI")
import Autodesk
from Autodesk.Revit.DB import *

clr.AddReference("RevitServices")
import RevitServices
from RevitServices.Persistence import DocumentManager
from RevitServices.Transactions import TransactionManager

doc = DocumentManager.Instance.CurrentDBDocument
TransactionManager.Instance.EnsureInTransaction(doc)

#The inputs to this node will be stored as a list in the IN variables.
output = list()

getDocUnits = doc.GetUnits()
getDisplayUnits = getDocUnits.GetFormatOptions(UnitType.UT_MassDensity).DisplayUnits

for group in IN[0]:
	surface = list()
	for i in group:
		strid = UnwrapElement(i).StructuralAssetId
		surface.append(UnitUtils.ConvertFromInternalUnits(doc.GetElement(strid).GetStructuralAsset().Density, getDisplayUnits))
	output.append(surface)

#Close TransactionManager
TransactionManager.Instance.TransactionTaskDone()

#Assign your output to the OUT variable.
OUT = output
# ----------------------------------------
code_block_74 = CodeBlock(x=getParameterValueByName_12, y=get_material_density) { x==0?y==null?2400:y:x; }
ofRepeatedItem_2 = List.OfRepeatedItem(item=code_block_74@@L1, amount=count_6@L1)
flatten_20 = Flatten(ofRepeatedItem_2@@L3)
getItemAtIndex_10 = List.GetItemAtIndex(list=flatten_20@L2, index=solidGroup@@L3)

floor_detail = CodeBlock(LevelNames=flatten_19, Density=getItemAtIndex_10) { LevelNames; Density; }

# group: Slab Geometry
code_block_75 = CodeBlock()
# ---------- code_block_75.designscript (4 lines) ----------
/*
Slab as Modelled
Slab Idealised
*/;
# ----------------------------------------
create_4 = List.Create(code_block_61.FloorAsIs, solidGroupS)

# group: Beam Geometry
code_block_76 = CodeBlock()
# ---------- code_block_76.designscript (4 lines) ----------
/*
Beam as Modelled
Beam Idealised
*/;
# ----------------------------------------
create_5 = List.Create(code_block_61.BeamsAsIs, code_block_63.IdealBeam)

flatten_21 = Flatten()  # unwired: arg0

# group: Column Floors
code_block_77 = CodeBlock(VoronoiSurface=buildSurfaceInter, Maxht=code_block_67.Maxht, Minht=code_block_67.Minht, ColumnID=checkSurf, FloorLevels=floor_detail.LevelNames)  # unwired: ColumnPoints
# ---------- code_block_77.designscript (9 lines) ----------
//Voronoi Data
VoronoiSurface;
//Floor Geometry
Maxht;
Minht;
//Column Geometry
ColumnPoints;
ColumnID;
FloorLevels;
# ----------------------------------------
flatten_22 = Flatten()  # unwired: arg0
groupByKey_3 = List.GroupByKey(list=flatten_22, keys=flatten_21)
flatten_23 = Flatten(groupByKey_3.groups)

# group: Check Line Map
perimeterCurves = Surface.PerimeterCurves(buildSurfaceInter)
ZAxis = Vector.ZAxis()
translate = Geometry.Translate(geometry=perimeterCurves@L3, direction=ZAxis, distance=code_block_77.Minht@L1)

code_block_78 = CodeBlock(x=code_block_77.ColumnPoints) { x[0][0]; }
tributarySolid = Tributary_Area.FloorSplit.TributarySolid(code_block_77.VoronoiSurface@L2, code_block_77.Maxht@L1, code_block_77.Minht@L1, code_block_77.FloorLevels@L1, code_block_78@L3, code_block_77.ColumnID@@L2)

# group (continued): Column Floors
code_block_79 = CodeBlock(FloorBlock=tributarySolid, LevelBySurface=flatten_22, ColumnBySurface=flatten_21, LevelByColumn=flatten_23) { FloorBlock; LevelBySurface; ColumnBySurface; LevelByColumn; }

count_8 = Count(code_block_79.ColumnBySurface)
code_block_80 = CodeBlock(Rounding=code_block_47.Rounding) { Rounding; }

# group: Calculate Slab Volume and Self Weight
splitVolumePar = Tributary_Area.FloorSplit.SplitVolumePar(code_block_79.FloorBlock, create_4)
getVolume = Custom[GetVolume](solid=splitVolumePar@@L2)  # The Solid.Volume node does not work when there are empty values in the list.
code_block_81 = CodeBlock(x=getVolume)
# ---------- code_block_81.designscript (2 lines) ----------
//Convert mm3 to m3
x/1000/1000/1000;
# ----------------------------------------
code_block_82 = CodeBlock(x=code_block_81, y=floor_detail.Density) { x<1><2><3><4>*y<0><2><3>; }
customAccumulation = Custom[CustomAccumulation](Values=code_block_82@@L6, keys=code_block_79.ColumnBySurface@L2, keys_2=code_block_79.LevelByColumn@L2, Rounding=code_block_80, lacing=Longest)  # Mass Addition of values to get sume
customAccumulation_2 = Custom[CustomAccumulation](Values=code_block_81@@L6, keys=code_block_79.ColumnBySurface@L2, keys_2=code_block_79.LevelByColumn@L2, Rounding=code_block_80, lacing=Longest)

# group: Tributary Area and Tributary Perimeter. Still has an issue.
flatten_24 = Flatten(splitVolumePar@@L3)  # frozen
byUnion = Solid.ByUnion(flatten_24@@L2)
upwardSurface_2 = Tributary_Area.GeometryDeconstruct.UpwardSurface(byUnion)
area = Surface.Area(upwardSurface_2)
code_block_83 = CodeBlock(x=area)
# ---------- code_block_83.designscript (2 lines) ----------
//Convert mm2 to m2
x/1000/1000;
# ----------------------------------------
flatten_25 = Flatten(code_block_83@@L3)
code_block_84 = CodeBlock { {0}; }
replaceNulls = Lists.Manage.ReplaceNulls(flatten_25, code_block_84, lacing=Longest)
customAccumulation_3 = Custom[CustomAccumulation](Values=replaceNulls@L6, keys=code_block_79.ColumnBySurface@L2, keys_2=code_block_79.LevelByColumn@L2, Rounding=code_block_47.Rounding, lacing=Longest)
surfaceExternalPerimeter = Custom[SurfaceExternalPerimeter](surfaces=upwardSurface_2)  # Gets the surface perimeter that is on the external part of the surface
flatten_26 = Flatten(surfaceExternalPerimeter@@L3)
XY = Plane.XY()
pullOntoPlane = Curve.PullOntoPlane(curve=flatten_26, plane=XY)
surfaceExternalPerimeter_2 = Custom[SurfaceExternalPerimeter](surfaces=regionUnion)  # frozen
intersect = Geometry.Intersect(geometry=pullOntoPlane@@L5, other=surfaceExternalPerimeter_2@L2, lacing=Longest)
flatten_27 = Flatten(intersect@@L3)
code_block_85 = CodeBlock(x=flatten_27) { DSCore.Object.Type(x) != "Autodesk.DesignScript.Geometry.Point"? x.Length : 0; }
customAccumulation_4 = Custom[CustomAccumulation](Values=code_block_85@L6, keys=code_block_79.ColumnBySurface@L2, keys_2=code_block_79.LevelByColumn@L2, Rounding=code_block_47.Rounding, lacing=Longest)

# group: Load Geometry and Values
code_block_86 = CodeBlock(AreaLoad=code_block_5.AreaLoad, LineLoad=code_block_5.LineLoad, PointLoad=code_block_5.PointLoad) { AreaLoad; LineLoad; PointLoad; }
code_block_87 = CodeBlock(AreaCase=code_block_48.AreaCase, LineCase=code_block_48.LineCase, FacadeCase=code_block_48.FacadeCase, PointCase=code_block_48.PointCase) { AreaCase; LineCase; FacadeCase; PointCase; }
code_block_88 = CodeBlock { "Load Case"; }
getParameterValueByName_14 = Element.GetParameterValueByName(element=code_block_86.AreaLoad, parameterName=code_block_88)
contains = Contains(code_block_87.AreaCase, getParameterValueByName_14@@L1)
filterByBoolMask_4 = List.FilterByBoolMask(list=code_block_86.AreaLoad, mask=contains)
geometry_8 = Element.Geometry(filterByBoolMask_4.in)
buildSurfaceSpline = Tributary_Area.GeometryInput.BuildSurfaceSpline(geometry_8@@L2)
regionDifferenceN = Tributary_Area.GeometryIntersect.RegionDifferenceN(buildSurfaceSpline@@L2)
get_vertical_z_force = Python(IN[0]=filterByBoolMask_4.in)
# ---------- get_vertical_z_force.python (32 lines) ----------
import clr

# Import RevitAPI
clr.AddReference("RevitAPI")
import Autodesk
from Autodesk.Revit.DB import *

# Import DocumentManager and TransactionManager
clr.AddReference("RevitServices")
import RevitServices
from RevitServices.Persistence import DocumentManager
from RevitServices.Transactions import TransactionManager

output = list()




# Start Transaction
doc = DocumentManager.Instance.CurrentDBDocument
TransactionManager.Instance.EnsureInTransaction(doc)

getDocUnits = doc.GetUnits()
getDisplayUnits = getDocUnits.GetFormatOptions(UnitType.UT_AreaForce).DisplayUnits
for i in IN[0]:
	output.append(UnitUtils.ConvertFromInternalUnits(UnwrapElement(i).ForceVector1.Z, getDisplayUnits))

# End Transaction
TransactionManager.Instance.TransactionTaskDone()

#Assign your output to the OUT variable.
OUT = output
# ----------------------------------------
code_block_89 = CodeBlock(ForceMultiplier=code_block_49) { ForceMultiplier; }
code_block_90 = CodeBlock(x=get_vertical_z_force, y=code_block_89) { x*y; }
getParameterValueByName_15 = Element.GetParameterValueByName(element=filterByBoolMask_4.in, parameterName=code_block_88)
getParameterValueByName_16 = Element.GetParameterValueByName(element=code_block_86.LineLoad, parameterName=code_block_88)
contains_2 = Contains(code_block_87.LineCase, getParameterValueByName_16@@L1)
filterByBoolMask_5 = List.FilterByBoolMask(list=code_block_86.LineLoad, mask=contains_2)
geometry_9 = Element.Geometry(filterByBoolMask_5.in)
get_vertical_z_force_2 = Python(IN[0]=filterByBoolMask_5.in)
# ---------- get_vertical_z_force_2.python (29 lines) ----------
import clr

# Import RevitAPI
clr.AddReference("RevitAPI")
import Autodesk
from Autodesk.Revit.DB import *

# Import DocumentManager and TransactionManager
clr.AddReference("RevitServices")
import RevitServices
from RevitServices.Persistence import DocumentManager
from RevitServices.Transactions import TransactionManager

output = list()

# Start Transaction
doc = DocumentManager.Instance.CurrentDBDocument
TransactionManager.Instance.EnsureInTransaction(doc)

getDocUnits = doc.GetUnits()
getDisplayUnits = getDocUnits.GetFormatOptions(UnitType.UT_LinearForce).DisplayUnits
for i in IN[0]:
	output.append(UnitUtils.ConvertFromInternalUnits(UnwrapElement(i).ForceVector1.Z, getDisplayUnits))

# End Transaction
TransactionManager.Instance.TransactionTaskDone()

#Assign your output to the OUT variable.
OUT = output
# ----------------------------------------
code_block_91 = CodeBlock(x=get_vertical_z_force_2, y=code_block_89) { x*y; }
getParameterValueByName_17 = Element.GetParameterValueByName(element=filterByBoolMask_5.in, parameterName=code_block_88)
getParameterValueByName_18 = Element.GetParameterValueByName(element=code_block_86.LineLoad, parameterName=code_block_88)
contains_3 = Contains(code_block_87.FacadeCase, getParameterValueByName_18@@L1)
filterByBoolMask_6 = List.FilterByBoolMask(list=code_block_86.LineLoad, mask=contains_3)
geometry_10 = Element.Geometry(filterByBoolMask_6.in)
get_vertical_z_force_3 = Python(IN[0]=filterByBoolMask_6.in)  # same code as get_vertical_z_force_2
code_block_92 = CodeBlock(x=get_vertical_z_force_3, y=code_block_89) { x*y; }
getParameterValueByName_19 = Element.GetParameterValueByName(element=filterByBoolMask_6.in, parameterName=code_block_88)
getParameterValueByName_20 = Element.GetParameterValueByName(element=code_block_86.PointLoad, parameterName=code_block_88)
contains_4 = Contains(code_block_87.PointCase, getParameterValueByName_20@@L1)
filterByBoolMask_7 = List.FilterByBoolMask(list=code_block_86.PointLoad, mask=contains_4)
geometry_11 = Element.Geometry(filterByBoolMask_7.in)
get_vertical_z_force_4 = Python(IN[0]=filterByBoolMask_7.in)
# ---------- get_vertical_z_force_4.python (29 lines) ----------
import clr

# Import RevitAPI
clr.AddReference("RevitAPI")
import Autodesk
from Autodesk.Revit.DB import *

# Import DocumentManager and TransactionManager
clr.AddReference("RevitServices")
import RevitServices
from RevitServices.Persistence import DocumentManager
from RevitServices.Transactions import TransactionManager

output = list()

# Start Transaction
doc = DocumentManager.Instance.CurrentDBDocument
TransactionManager.Instance.EnsureInTransaction(doc)

getDocUnits = doc.GetUnits()
getDisplayUnits = getDocUnits.GetFormatOptions(UnitType.UT_Force).DisplayUnits
for i in IN[0]:
	output.append(UnitUtils.ConvertFromInternalUnits(UnwrapElement(i).ForceVector.Z, getDisplayUnits))

# End Transaction
TransactionManager.Instance.TransactionTaskDone()

#Assign your output to the OUT variable.
OUT = output
# ----------------------------------------
code_block_93 = CodeBlock(x=get_vertical_z_force_4, y=code_block_89) { x*y; }
getParameterValueByName_21 = Element.GetParameterValueByName(element=filterByBoolMask_7.in, parameterName=code_block_88)
code_block_94 = CodeBlock(AreaLoadSurf=regionDifferenceN, AreaLoadVal=code_block_90, AreaLoadCase=getParameterValueByName_15, LineLoadLine=geometry_9, LineLoadVal=code_block_91, LineLoadCase=getParameterValueByName_17, FacadeLoadLine=geometry_10, FacadeLoadVal=code_block_92, FacadeLoadCase=getParameterValueByName_19, PointLoadPoint=geometry_11, PointLoadVal=code_block_93, PointLoadCase=getParameterValueByName_21)
# ---------- code_block_94.designscript (12 lines) ----------
AreaLoadSurf;
AreaLoadVal;
AreaLoadCase;
LineLoadLine;
LineLoadVal;
LineLoadCase;
FacadeLoadLine;
FacadeLoadVal;
FacadeLoadCase;
PointLoadPoint;
PointLoadVal;
PointLoadCase;
# ----------------------------------------

# group: Calculate Load Distribution
code_block_95 = CodeBlock(AreaLoadSurf=code_block_94.AreaLoadSurf, AreaLoadVal=code_block_94.AreaLoadVal, AreaLoadCase=code_block_94.AreaLoadCase, LineLoadLine=code_block_94.LineLoadLine, LineLoadVal=code_block_94.LineLoadVal, LineLoadCase=code_block_94.LineLoadCase, FacadeLoadLine=code_block_94.FacadeLoadLine, FacadeLoadVal=code_block_94.FacadeLoadVal, FacadeLoadCase=code_block_94.FacadeLoadCase, PointLoadPoint=code_block_94.PointLoadPoint, PointLoadVal=code_block_94.PointLoadVal, PointLoadCase=code_block_94.PointLoadCase)  # same code as code_block_94
code_block_96 = CodeBlock(FloorSolid=code_block_79.FloorBlock, AreaLoadSurf=code_block_95.AreaLoadSurf)
# ---------- code_block_96.designscript (2 lines) ----------
//Level/Floor/Surface
FloorSolid<1><2><3>.Intersect(AreaLoadSurf<0><0><4>);
# ----------------------------------------
flatten_28 = Flatten(code_block_96@@L3)
getArea = Custom[GetArea](surface=flatten_28)  # Get Area of Surface, ignore if not a surface
code_block_97 = CodeBlock(x=getArea) { x/1000/1000; }
mul = code_block_97@@L2 * code_block_95.AreaLoadVal@L2  # lacing=Longest
loadAccumulator = Custom[LoadAccumulator](count=count_8, digits=code_block_80, keys=code_block_79.LevelByColumn, keys_2=code_block_79.ColumnBySurface, loadcases=code_block_95.AreaLoadCase, values=mul)  # Accumulates loading values
code_block_98 = CodeBlock(FloorSolid=code_block_79.FloorBlock, LineLoadLine=code_block_95.LineLoadLine)
# ---------- code_block_98.designscript (2 lines) ----------
//Level/Floor/Surface
FloorSolid<1><2><3>.Intersect(LineLoadLine<0><0><4>);
# ----------------------------------------
flatten_29 = Flatten(code_block_98@@L3)
getLength = Custom[GetLength](curve=flatten_29)  # Gets the Length of curve elements.
code_block_99 = CodeBlock(x=getLength) { x/1000; }
mul_2 = code_block_99@@L2 * code_block_95.LineLoadVal@L2  # lacing=Longest
loadAccumulator_2 = Custom[LoadAccumulator](count=count_8, digits=code_block_80, keys=code_block_79.LevelByColumn, keys_2=code_block_79.ColumnBySurface, loadcases=code_block_95.LineLoadCase, values=mul_2)
code_block_100 = CodeBlock(FloorSolid=code_block_79.FloorBlock, FacadeLoadLine=code_block_95.FacadeLoadLine)
# ---------- code_block_100.designscript (2 lines) ----------
//Level/Floor/Surface
FloorSolid<1><2><3>.Intersect(FacadeLoadLine<0><0><4>);
# ----------------------------------------
flatten_30 = Flatten(code_block_100@@L3)
getLength_2 = Custom[GetLength](curve=flatten_30)
code_block_101 = CodeBlock(x=getLength_2) { x/1000; }
mul_3 = code_block_101@@L2 * code_block_95.FacadeLoadVal@L2  # lacing=Longest
loadAccumulator_3 = Custom[LoadAccumulator](count=count_8, digits=code_block_80, keys=code_block_79.LevelByColumn, keys_2=code_block_79.ColumnBySurface, loadcases=code_block_95.FacadeLoadCase, values=mul_3)
code_block_102 = CodeBlock(FloorSolid=code_block_79.FloorBlock, PointLoad=code_block_95.PointLoadPoint)
# ---------- code_block_102.designscript (2 lines) ----------
//Level/Floor/Surface
FloorSolid<1><2><3>.Intersect(PointLoad<0><0><4>);
# ----------------------------------------
flatten_31 = Flatten(code_block_102@@L3)
count_9 = List.Count(flatten_31@@L2)
mul_4 = count_9@@L2 * code_block_95.PointLoadVal@L2  # lacing=Longest
loadAccumulator_4 = Custom[LoadAccumulator](count=count_8, digits=code_block_80, keys=code_block_79.LevelByColumn, keys_2=code_block_79.ColumnBySurface, loadcases=code_block_95.PointLoadCase, values=mul_4)
create_6 = List.Create(loadAccumulator.OUT0, loadAccumulator_2.OUT0, loadAccumulator_3.OUT0, loadAccumulator_4.OUT0)
create_7 = List.Create(loadAccumulator.OUT1, loadAccumulator_2.OUT1, loadAccumulator_3.OUT1, loadAccumulator_4.OUT1)

code_block_103 = CodeBlock { {"Beam-Beam As Modeled","Beam-Slab As Modeled","Beam-Column As Modeled","Beam-Wall As Modeled","Slab-Colunn As Modeled","Slab-Wall As Modeled","Beam-Beam Unjoined","Beam-Slab Unjoined"}; }
code_block_104 = CodeBlock { {false,false,false,false,false,false,false,false}; }
filterByBoolMask_8 = List.FilterByBoolMask(list=code_block_103, mask=code_block_104)

# group: Beam Density
code_block_105 = CodeBlock { "Type"; "Structural Material"; }
getParameterValueByName_22 = Element.GetParameterValueByName(element=uniqueItems_7, parameterName=code_block_105.out0)
getParameterValueByName_23 = Element.GetParameterValueByName(element=getParameterValueByName_22, parameterName=code_block_47.DensityParam)
getParameterValueByName_24 = Element.GetParameterValueByName(element=getParameterValueByName_22, parameterName=code_block_105.out1)
get_material_density_2 = Python(IN[0]=getParameterValueByName_24)
# ---------- get_material_density_2.python (29 lines) ----------
#Assign your output to the OUT variable.
import clr

clr.AddReference("RevitAPI")
import Autodesk
from Autodesk.Revit.DB import *

clr.AddReference("RevitServices")
import RevitServices
from RevitServices.Persistence import DocumentManager
from RevitServices.Transactions import TransactionManager

doc = DocumentManager.Instance.CurrentDBDocument
TransactionManager.Instance.EnsureInTransaction(doc)

#The inputs to this node will be stored as a list in the IN variables.
output = list()

getDocUnits = doc.GetUnits()
getDisplayUnits = getDocUnits.GetFormatOptions(UnitType.UT_MassDensity).DisplayUnits
for i in IN[0]:
	strid = UnwrapElement(i).StructuralAssetId
	output.append(UnitUtils.ConvertFromInternalUnits(doc.GetElement(strid).GetStructuralAsset().Density, getDisplayUnits))

#Close TransactionManager
TransactionManager.Instance.TransactionTaskDone()

#Assign your output to the OUT variable.
OUT = output
# ----------------------------------------
code_block_106 = CodeBlock(x=getParameterValueByName_23, y=get_material_density_2) { x==0?y==null?2400:y:x; }

# group: Calculate Beam Volume and Self Weight
code_block_107 = CodeBlock(x=count_8) { x*2; }
flatten_32 = Flatten(create_5@@L3)
splitVolumeAll = Tributary_Area.FloorSplit.SplitVolumeAll(code_block_79.FloorBlock, flatten_32@@L2)
getVolume_2 = Custom[GetVolume](solid=splitVolumeAll@@L2)
code_block_108 = CodeBlock(x=getVolume_2)  # same code as code_block_81
mul_5 = code_block_106@L2 * code_block_108@@L3  # lacing=Longest
customAccumulation_5 = Custom[CustomAccumulation](Values=mul_5@@L6, keys=code_block_79.ColumnBySurface@L2, keys_2=code_block_79.LevelByColumn@L2, Rounding=code_block_80, lacing=Longest)
checkVal = Custom[CheckVal](list=code_block_107, list_2=customAccumulation_5.Values)  # Checks the values and ensure that it isn't null
customAccumulation_6 = Custom[CustomAccumulation](Values=code_block_108@@L6, keys=code_block_79.ColumnBySurface@L2, keys_2=code_block_79.LevelByColumn@L2, Rounding=code_block_80, lacing=Longest)
checkVal_2 = Custom[CheckVal](list=code_block_107, list_2=customAccumulation_6.Values)
checkVal_3 = Custom[CheckVal](list=code_block_107, list_2=customAccumulation_5.Cummulative)
checkVal_4 = Custom[CheckVal](list=code_block_107, list_2=customAccumulation_6.Cummulative)

# group: WIP Geometry Intersect
flatten_33 = Flatten(code_block_61.BeamsAsIs)
flatten_34 = Flatten(code_block_63.IdealBeam)
code_block_109 = CodeBlock(ModelledBeam=flatten_33, CompleteBeam=flatten_34) { ModelledBeam; CompleteBeam; }
flatten_35 = Flatten(code_block_109.ModelledBeam)
minSolidIntersection = Tributary_Area.GeometryIntersect.MinSolidIntersection(flatten_35)
code_block_110 = CodeBlock(Geo=minSolidIntersection)
# ---------- code_block_110.designscript (3 lines) ----------
//Beam-Beam Intersection as Modelled
//If Modelled Correctly, this should be null
Geo;
# ----------------------------------------
byUnion_2 = Solid.ByUnion(code_block_109.ModelledBeam)
code_block_111 = CodeBlock(ModelledSlab=code_block_61.FloorAsIs, ModelledColumn=code_block_61.ColumnAsIs, ModelledWall=code_block_61.WallAsIs) { ModelledSlab; ModelledColumn; ModelledWall; }
addItemToEnd_2 = List.AddItemToEnd(item=byUnion_2, list=code_block_111.ModelledSlab)
flatten_36 = Flatten(addItemToEnd_2)
minSolidIntersection_2 = Tributary_Area.GeometryIntersect.MinSolidIntersection(flatten_36)
code_block_112 = CodeBlock(Geo=minSolidIntersection_2)
# ---------- code_block_112.designscript (3 lines) ----------
//Beam-Slab Intersection as Modelled
//If Modelled Correctly, this should be null
Geo;
# ----------------------------------------
addItemToEnd_3 = List.AddItemToEnd(item=byUnion_2, list=code_block_111.ModelledColumn)
flatten_37 = Flatten(addItemToEnd_3)
minSolidIntersection_3 = Tributary_Area.GeometryIntersect.MinSolidIntersection(flatten_37)
code_block_113 = CodeBlock(Geo=minSolidIntersection_3)
# ---------- code_block_113.designscript (3 lines) ----------
//Beam-Column Intersection as Modelled
//If Modelled Correctly, this should be null
Geo;
# ----------------------------------------
addItemToEnd_4 = List.AddItemToEnd(item=byUnion_2, list=code_block_111.ModelledWall)
flatten_38 = Flatten(addItemToEnd_4)
minSolidIntersection_4 = Tributary_Area.GeometryIntersect.MinSolidIntersection(flatten_38)
code_block_114 = CodeBlock(Geo=minSolidIntersection_4)
# ---------- code_block_114.designscript (3 lines) ----------
//Beam-Wall Intersection as Modelled
//If Modelled Correctly, this should be null
Geo;
# ----------------------------------------
addItemToEnd_5 = List.AddItemToEnd(item=code_block_111.ModelledSlab, list=code_block_111.ModelledColumn)
flatten_39 = Flatten(addItemToEnd_5)
minSolidIntersection_5 = Tributary_Area.GeometryIntersect.MinSolidIntersection(flatten_39)
code_block_115 = CodeBlock(Geo=minSolidIntersection_5)
# ---------- code_block_115.designscript (3 lines) ----------
//Slab-Column Intersection as Modelled
//If Modelled Correctly, this should be null
Geo;
# ----------------------------------------
addItemToEnd_6 = List.AddItemToEnd(item=code_block_111.ModelledSlab, list=code_block_111.ModelledWall)
flatten_40 = Flatten(addItemToEnd_6)
minSolidIntersection_6 = Tributary_Area.GeometryIntersect.MinSolidIntersection(flatten_40)
code_block_116 = CodeBlock(Geo=minSolidIntersection_6)
# ---------- code_block_116.designscript (3 lines) ----------
//Slab-Wall Intersection as Modelled
//If Modelled Correctly, this should be null
Geo;
# ----------------------------------------
flatten_41 = Flatten(code_block_109.CompleteBeam)
minSolidIntersection_7 = Tributary_Area.GeometryIntersect.MinSolidIntersection(flatten_41)
code_block_117 = CodeBlock(Geo=minSolidIntersection_7)
# ---------- code_block_117.designscript (2 lines) ----------
//Beam-Beam Intersection in Ideal Case
Geo;
# ----------------------------------------
byUnion_3 = Solid.ByUnion(code_block_109.CompleteBeam)
flatten_42 = Flatten(geometry_6)
byUnion_4 = Solid.ByUnion(flatten_42)
addItemToEnd_7 = List.AddItemToEnd(item=byUnion_3, list=byUnion_4)
flatten_43 = Flatten(addItemToEnd_7)
minSolidIntersection_8 = Tributary_Area.GeometryIntersect.MinSolidIntersection(flatten_43)
code_block_118 = CodeBlock(Geo=minSolidIntersection_8)  # same code as code_block_112

create_8 = List.Create(code_block_110, code_block_112, code_block_113, code_block_114, code_block_115, code_block_116, code_block_117, code_block_118)
filterByBoolMask_9 = List.FilterByBoolMask(list=create_8, mask=code_block_104)
count_10 = List.Count(filterByBoolMask_9.in)
code_block_119 = CodeBlock(x=count_8, LL=count_10) { x*LL; }
code_block_120 = CodeBlock { 1; }
chop_2 = List.Chop(list=filterByBoolMask_9.in, lengths=code_block_120)
splitVolumeAll_2 = Tributary_Area.FloorSplit.SplitVolumeAll(code_block_79.FloorBlock, chop_2@@L2)
getVolume_3 = Custom[GetVolume](solid=splitVolumeAll_2@@L2)
code_block_121 = CodeBlock(x=getVolume_3)  # same code as code_block_81
customAccumulation_7 = Custom[CustomAccumulation](Values=code_block_121@@L6, keys=code_block_79.ColumnBySurface@L2, keys_2=code_block_79.LevelByColumn@L2, Rounding=code_block_80, lacing=Longest)
checkVal_5 = Custom[CheckVal](list=code_block_119, list_2=customAccumulation_7.Values)
checkVal_6 = Custom[CheckVal](list=code_block_119, list_2=customAccumulation_7.Cummulative)

# group: Export Result to Excel*
code_block_122 = CodeBlock(OutputFile=code_block_47.OutputFile, Sheetname=code_block_47.Sheetname, Overwrite=code_block_47.Overwrite) { OutputFile; Sheetname; Overwrite; }
code_block_123 = CodeBlock { 0; 0; }
create_9 = List.Create(loadAccumulator.Unique, loadAccumulator_2.Unique, loadAccumulator_3.Unique, loadAccumulator_4.Unique)
count_11 = List.Count(create_9@@L2)
flatten_44 = Flatten(count_11)
code_block_124 = CodeBlock()
# ---------- code_block_124.designscript (10 lines) ----------
"ID";
"Level";
"Floor Self Weight As Modelled";
"Floor Self Weight As Idealised";
"Volume As Modelled";
"Volume as Idealised";
"Beam Self Weight As Modelled";
"Beam Self Weight As Idealised";
"Beam Volume As Modelled";
"Beam Volume As Idealised";
# ----------------------------------------
create_10 = List.Create(code_block_124.out2, code_block_124.out3, code_block_124.out4, code_block_124.out5, code_block_124.out6, code_block_124.out7, code_block_124.out8, code_block_124.out9)
python_script_9 = Python(IN[0]=flatten_44, IN[1]=create_10, IN[2]=filterByBoolMask_8.in)
# ---------- python_script_9.python (33 lines) ----------
import clr
clr.AddReference('ProtoGeometry')
from Autodesk.DesignScript.Geometry import *
#The inputs to this node will be stored as a list in the IN variables.
out = list()

LoadList = ["Area Load","Line Load", "Facade Load", "Point Load"]
Load = list()

for i in IN[0]:
	if i > 0:
		Load.append(LoadList[0])
	for x in xrange(i-1):
		Load.append("")
	LoadList.pop(0)
	

out.append("Object")
out.append("")
out.append("Slab Interstorey")
for i in xrange(len(IN[1])-1):
	out.append("")
for i in xrange(len(IN[2])):
	out.append("")
out.append(Load)
out.append("Slab Cummulative")
for i in xrange(len(IN[1])-1):
	out.append("")
for i in xrange(len(IN[2])):
	out.append("")
out.append(Load)
#Assign your output to the OUT variable.
OUT = out
# ----------------------------------------
flatten_45 = Flatten(python_script_9)
flatten_46 = Flatten(create_9)
python_script_10 = Python(IN[0]=flatten_46)  # same code as python_script
create_11 = List.Create(code_block_124.out0, code_block_124.out1, create_10, filterByBoolMask_8.in, python_script_10, create_10, filterByBoolMask_8.in, python_script_10)
flatten_47 = Flatten(create_11)
addItemToFront = List.AddItemToFront(item=flatten_45@L1, list=flatten_47@L1, lacing=Longest)
create_12 = List.Create(code_block_79.ColumnBySurface, code_block_79.LevelBySurface, customAccumulation.Values, customAccumulation_2.Values, checkVal, checkVal_2, checkVal_5, create_6, customAccumulation.Cummulative, customAccumulation_2.Cummulative, checkVal_3, checkVal_4, checkVal_6, create_7)
flatten_48 = Flatten(create_12)
removeNulls_2 = Lists.Manage.RemoveNulls(flatten_48)
chop_3 = List.Chop(list=removeNulls_2, lengths=count_8)
addItemToFront_2 = List.AddItemToFront(item=addItemToFront@L2, list=chop_3@L2, lacing=Longest)
flatten_49 = Flatten(addItemToFront_2@@L3)
transpose = List.Transpose(flatten_49@L3)
writeToFile = Excel.WriteToFile(filePath=code_block_122.OutputFile, sheetName=code_block_122.Sheetname, startRow=code_block_123.out0, startCol=code_block_123.out1, data=transpose, overWrite=code_block_122.Overwrite)

code_block_125 = CodeBlock(x=create_8) { x!=null; }
create_13 = List.Create(splitVolumePar, splitVolumeAll)
flatten_50 = Flatten(create_13)
edges = Topology.Edges(flatten_50)
curveGeometry = Edge.CurveGeometry(edges)
code_block_126 = CodeBlock { "Hello"; }
writeToFile_2 = Excel.WriteToFile(filePath=code_block_122.OutputFile, sheetName=code_block_122.Sheetname, startRow=code_block_123.out0, startCol=code_block_123.out1, data=code_block_126, overWrite=code_block_122.Overwrite)  # frozen
code_block_127 = CodeBlock { 1; }
getItemAtIndex_11 = List.GetItemAtIndex(list=transpose@L3, index=code_block_127)
python_script_11 = Python(IN[0]=flatten_44, IN[1]=create_10, IN[2]=filterByBoolMask_8.in)  # same code as python_script_9
boolean_11 = BoolSelector(false)
string = StringInput("")
code_block_128 = CodeBlock(x=create_8) { (x==null?false:true); }
watch = Watch(code_block_128)
getItemAtIndex_12 = List.GetItemAtIndex()  # unwired: list, index
watch_2 = Watch(floor_detail.LevelNames)
watch_3 = Watch()  # unwired: arg0
watch_4 = Watch(code_block_95.AreaLoadSurf)
watch_5 = Watch(code_block_95.AreaLoadVal)
watch_6 = Watch(code_block_95.AreaLoadVal)
voronoiFortuneUV_2 = CustomVoronoi.VoronoiCustom.VoronoiFortuneUV(code_block_70.UVPts@L1, code_block_70.FloorSurface)
removeNulls_3 = Lists.Manage.RemoveNulls(regionUnion)
watch_7 = Watch(code_block_77.VoronoiSurface)
watch_8 = Watch(code_block_77.ColumnPoints)
code_block_129 = CodeBlock(x=code_block_77.VoronoiSurface) { x[0]; }
code_block_130 = CodeBlock(x=code_block_77.Maxht) { x[0][0]; }
code_block_131 = CodeBlock(x=code_block_77.Minht) { x[0][0]; }
code_block_132 = CodeBlock(x=code_block_77.FloorLevels) { x[0][0][0]; }
code_block_133 = CodeBlock(x=code_block_77.ColumnID) { x[0][0]; }
tributarySolid_2 = Tributary_Area.FloorSplit.TributarySolid(code_block_129, code_block_130, code_block_131, code_block_132, code_block_78, code_block_133)
