# Dynamo graph Units - 01.dyn (Dynamo 1.3.1.1736)

select_model_element = DSModelElementSelection()  # 1 picked in the model
parameters = Element.Parameters(select_model_element)
unitType = Parameter.UnitType(parameters)
code_block = CodeBlock()
# ---------- code_block.designscript (4 lines) ----------
def UT_HVAC_AirFlow(a)
{
return = a/28.31684;
};
# ----------------------------------------
code_block_2 = CodeBlock { 50; }
code_block_3 = CodeBlock(a=code_block_2) { UT_HVAC_AirFlow(a); }
select_model_element_2 = DSModelElementSelection()

# group: Revit Project Units - Get
code_block_4 = CodeBlock { "Additional Flow"; }
getParameterAsProjectUnits = Custom[GetParameterAsProjectUnits](Elements=select_model_element_2, ParameterName=code_block_4)  # Returns the parameter value in the same unit type as the project settings

# group: Revit Project Units - Set
select_model_element_3 = DSModelElementSelection()
code_block_5 = CodeBlock { "Additional Flow"; }
code_block_6 = CodeBlock { 300; }
setParameterAsProjectUnits = Custom[SetParameterAsProjectUnits](Elements=select_model_element_3, ParameterName=code_block_5, Values=code_block_6)  # Sets the parameters by project unit inputs, no need to convert to Revit internal units first.

# group: Revit Internal Units - Get
code_block_7 = CodeBlock { "Additional Flow"; }
getParameterValueByName = Element.GetParameterValueByName(element=select_model_element_2, parameterName=code_block_7)

code_block_8 = CodeBlock { {123,456,123,123,456,456}; }
code_block_9 = CodeBlock { 123; }
allIndicesOf = List.AllIndicesOf(list=code_block_8, item=code_block_9)
getItemAtIndex = List.GetItemAtIndex(list=code_block_8, index=allIndicesOf)
code_block_10 = CodeBlock { {123,456,123,123,456,456}; }
code_block_11 = CodeBlock(a=code_block_10) { a==123; }
filterByBoolMask = List.FilterByBoolMask(list=code_block_10, mask=code_block_11)
select_model_elements = DSModelElementsSelection()
code_block_12 = CodeBlock { "Mark"; }
code_block_13 = CodeBlock { "Mark"; }
getParameterValueByName_2 = Element.GetParameterValueByName(element=select_model_elements, parameterName=code_block_13)
code_block_14 = CodeBlock(a=getParameterValueByName_2) { a=="123"; }
code_block_15 = CodeBlock { "456"; }
if_ = If(test=code_block_14, true=code_block_15, false=getParameterValueByName_2)
setParameterByName = Element.SetParameterByName(element=select_model_elements, parameterName=code_block_12, value=if_)
name = Element.Name(parameters)
code_block_16 = CodeBlock { 1; }
python_script = Python(IN[0]=select_model_element, IN[1]=name, IN[2]=code_block_16)
# ---------- python_script.python (53 lines) ----------
import clr
clr.AddReference('ProtoGeometry')
from Autodesk.DesignScript.Geometry import *
clr.AddReference('RevitAPI')
from Autodesk.Revit.DB import *

clr.AddReference("RevitServices")
import RevitServices
from RevitServices.Persistence import DocumentManager
from RevitServices.Transactions import TransactionManager
doc = DocumentManager.Instance.CurrentDBDocument
#The inputs to this node will be stored as a list in the IN variables.

element = UnwrapElement(IN[0])
name = IN[1]
values = IN[2]

parameters = []
listout = []
newValues = []
PU = []
Display = []
US = UnitUtils.GetValidDisplayUnits()
removed = []

def checkParameter(param):
	for p in param:
		internal = p.Definition
		if internal.BuiltInParameter != BuiltInParameter.INVALID:
			return p
	return param[0]

for n in name:
	param = element.GetParameters(n)
	if len(param) == 0:
		parameters.append(None)
	else:
		p = checkParameter(param)
		parameters.append(p)
		listout.append(p.StorageType)
		listout.append(p.Definition)

for p in parameters:
	try:
		ProjectUnits = p.DisplayUnitType
		Names = str(p.Definition.Name) + "[" + str(p.StorageType) + "]"
		Display.append(Names)
		PU.append(ProjectUnits)
		newValues.append(UnitUtils.ConvertToInternalUnits(values,ProjectUnits))
	except:
		removed.append(p.Definition.Name)
#Assign your output to the OUT variable.
OUT = Display, PU, newValues, US, removed
# ----------------------------------------
code_block_17 = CodeBlock(a=python_script) { a[2]; }
code_block_18 = CodeBlock { {10}; }
convertToInternalUnits = Python(IN[0]=code_block_18)
# ---------- convertToInternalUnits.python (27 lines) ----------
import clr
clr.AddReference('ProtoGeometry')
from Autodesk.DesignScript.Geometry import *
clr.AddReference('RevitAPI')
from Autodesk.Revit.DB import *

clr.AddReference("RevitServices")
import RevitServices
from RevitServices.Persistence import DocumentManager
from RevitServices.Transactions import TransactionManager
doc = DocumentManager.Instance.CurrentDBDocument
#The inputs to this node will be stored as a list in the IN variables.

values = IN[0]


listout = []
newValues = []



for v in values:
	ProjectUnits = DisplayUnitType.DUT_WATTS
	newValues.append(UnitUtils.ConvertToInternalUnits(v,ProjectUnits))
	
#Assign your output to the OUT variable.
OUT = newValues
# ----------------------------------------
code_block_19 = CodeBlock(a=python_script) { a[1]; }
code_block_20 = CodeBlock(a=code_block_19) { a[44]; }
code_block_21 = CodeBlock(a=python_script) { a[4]; }
code_block_22 = CodeBlock { "Design Cooling Load"; }
code_block_23 = CodeBlock { {20}; }
code_block_24 = CodeBlock { "DUT_WATTS"; }
convertToInternalUnits_2 = Python(IN[0]=code_block_23, IN[1]=code_block_24)
# ---------- convertToInternalUnits_2.python (34 lines) ----------
import clr
clr.AddReference('ProtoGeometry')
from Autodesk.DesignScript.Geometry import *
clr.AddReference('RevitAPI')
from Autodesk.Revit.DB import *

clr.AddReference("RevitServices")
import RevitServices
from RevitServices.Persistence import DocumentManager
from RevitServices.Transactions import TransactionManager
doc = DocumentManager.Instance.CurrentDBDocument
#The inputs to this node will be stored as a list in the IN variables.

values = IN[0]
test = IN[1]

index = []
newValues = []

units = UnitUtils.GetValidDisplayUnits()

for i in range(0,len(units)):
	if units[i].ToString() == test:
		index = i
"""
for v in values:
	newValues.append(UnitUtils.ConvertToInternalUnits(v,units[index]))
"""

for i in range(0,len(values)):
	newValues.append(UnitUtils.ConvertToInternalUnits(values[i],units[index]))

#Assign your output to the OUT variable.
OUT = newValues, units
# ----------------------------------------
setParameterByName_2 = Element.SetParameterByName(element=select_model_element, parameterName=code_block_22, value=convertToInternalUnits_2)
code_block_25 = CodeBlock(a=python_script) { a[0]; }
code_block_26 = CodeBlock(a=code_block_25) { a[44]; }
