# Dynamo graph UsageTest.dyn (Dynamo 1.3.1.1736)

python_script = Python()  # unwired: IN[0]
# ---------- python_script.python (7 lines) ----------
import clr
import sys
sys.path.append(r'C:\Users\giovanni.brogiolo\Dropbox')

import dypy
  
OUT = dypy.summary
# ----------------------------------------
code_block = CodeBlock { Point.ByCoordinates(x); }  # unwired: x
code_block_2 = CodeBlock { Point.ByCoordinates(x); }  # unwired: x
code_block_3 = CodeBlock { Point.ByCoordinates(x); }  # unwired: x
