# Dynamo graph VoidTags07.dyn (Dynamo 2.0.2.6826)

current = Document.Current()
activeView = Document.ActiveView(document=current)
refresh = BoolSelector(false)
python_script = Python(IN[0]=refresh)
# ---------- python_script.python (55 lines) ----------
import clr

clr.AddReference("RevitAPIUI")
from Autodesk.Revit.UI import IExternalEventHandler, ExternalEvent, TaskDialog
from Autodesk.Revit.UI.Selection import *

clr.AddReference("RevitAPI")
from Autodesk.Revit.DB import Transaction, OverrideGraphicSettings, ElementId, Color
# noinspection PyUnresolvedReferences
from Autodesk.Revit.Exceptions import InvalidOperationException


clr.AddReference('RevitServices')
from RevitServices.Persistence import DocumentManager


global result



doc = DocumentManager.Instance.CurrentDBDocument
uidoc = DocumentManager.Instance.CurrentUIApplication.ActiveUIDocument


class CustomISelectionFilter(ISelectionFilter):
	def __init__(self, category_name):
		self.category_name = category_name
	def AllowElement(self, e):
		if e.Category.Name == self.category_name:
			return True
		else:
			return False
	def AllowReference(self, ref, point):
		return false

ref = uidoc.Selection.PickObjects(ObjectType.Element, CustomISelectionFilter("Structural Connections"), "Select Penetrations")

result = []


for r in ref:
	ele = doc.GetElement(r)
	if ele.Name == "Web_Peno_C":
		name = "Web_Peno_Circular_Tag"
	else:
		name = "Web_Peno_Tag"
	loc = ele.Location
	rotation = str(round(loc.Rotation,3))
	if rotation == "2.094":
		orientation = 1
	else:
		orientation = 0
	result.append([ele, name, rotation, orientation])

OUT = result
# ----------------------------------------
code_block = CodeBlock { 0; }

# group: peno element
getItemAtIndex = List.GetItemAtIndex(list=python_script, index=code_block, lacing=Longest)

python_script_2 = Python(IN[0]=getItemAtIndex)
# ---------- python_script_2.python (57 lines) ----------
import clr

clr.AddReference("RevitAPI")
from Autodesk.Revit.DB import *
# noinspection PyUnresolvedReferences
from Autodesk.Revit.Exceptions import InvalidOperationException

clr.AddReference('RevitServices')
from RevitServices.Persistence import DocumentManager

clr.AddReference("RevitNodes")
import Revit
# Import ToProtoType, ToRevitType geometry conversion extension methods
clr.ImportExtensions(Revit.GeometryConversion)

def GetParam(element, paramName):
	for p in element.Parameters:
		if p.Definition.Name == paramName:
			if p.StorageType == StorageType.String:
				return p.AsString()
			elif p.StorageType == StorageType.ElementId:
				elem = doc.GetElement(p.AsElementId())
				return elem
			elif p.StorageType == StorageType.Double:
				ProjectUnits = p.DisplayUnitType
				newval = UnitUtils.ConvertFromInternalUnits(p.AsDouble(),ProjectUnits)
				return newval
			else:
				return p.AsInteger()

def GetBeamWidth(element):
	opt = Options()
	opt.ComputeReferences = True
	opt.IncludeNonVisibleObjects = False
	opt.View = doc.ActiveView
	
	for instance in element.get_Geometry(opt):
		try:
			geomInst = instance.GetSymbolGeometry()
			instTransform = instance.Transform;
			width = (geomInst.GetBoundingBox().Max.Y - geomInst.GetBoundingBox().Min.Y)*304.8
		except:
			continue
	return width


doc = DocumentManager.Instance.CurrentDBDocument
uidoc = DocumentManager.Instance.CurrentUIApplication.ActiveUIDocument

penos = UnwrapElement(IN[0])

points = [p.Location.Point.ToPoint() for p in penos]
distance = [int(GetParam(p, "P_Distance from Start")) for p in penos]

host = [p.Host.Location.Curve.Direction.ToVector() for p in penos]

OUT = points, host, distance, [GetBeamWidth(p.Host) for p in penos]
# ----------------------------------------
code_block_2 = CodeBlock(a=python_script_2) { a[0]; a[1]; a[2]; a[3]; }
translate = Geometry.Translate(geometry=code_block_2.out0, direction=code_block_2.out1, distance=code_block_2.out2)
ZAxis = Vector.ZAxis()
cross = Vector.Cross(vector=code_block_2.out1, cross=ZAxis)
code_block_3 = CodeBlock { 300; }
translate_2 = Geometry.Translate(geometry=translate, direction=cross, distance=code_block_3)
byElementAndLocation = Tag.ByElementAndLocation(view=activeView, element=getItemAtIndex, location=translate_2)
code_block_4 = CodeBlock { ["Type","Orientation"]; }
code_block_5 = CodeBlock { 3; }

# group: orientation
getItemAtIndex_2 = List.GetItemAtIndex(list=python_script, index=code_block_5, lacing=Longest)

code_block_6 = CodeBlock { ["2.484","2.094","1.912","1.571","3.142","2.298"]; }
code_block_7 = CodeBlock { 1; }

# group: tag name
getItemAtIndex_3 = List.GetItemAtIndex(list=python_script, index=code_block_7, lacing=Longest)

byName = Family.ByName(name=getItemAtIndex_3)
types = Family.Types(family=byName)
code_block_8 = CodeBlock { [2,6,1,0,0,0]; }
getItemAtIndex_4 = List.GetItemAtIndex(list=types, index=code_block_8, lacing=CrossProduct)
byKeysValues = DesignScript.Builtin.Dictionary.ByKeysValues(keys=code_block_6@L2, values=getItemAtIndex_4, lacing=Longest)
code_block_9 = CodeBlock { 2; }

# group: rotation
getItemAtIndex_5 = List.GetItemAtIndex(list=python_script, index=code_block_9, lacing=Longest)

valueAtKey = DesignScript.Builtin.Dictionary.ValueAtKey(dictionary=byKeysValues, key=getItemAtIndex_5)
addItemToEnd = List.AddItemToEnd(item=getItemAtIndex_2, list=valueAtKey, lacing=Longest)
setParameterByName = Element.SetParameterByName(element=byElementAndLocation, parameterName=code_block_4@L2, value=addItemToEnd, lacing=Longest)
uniqueItems = List.UniqueItems(list=getItemAtIndex_5)
