# Dynamo graph WallVolumeMultipleElements.dyn (Dynamo 1.3.1.1736)

select_model_elements = DSModelElementsSelection()  # 5 picked in the model
get_host_element = Custom[Get Host Element](hostedElement=select_model_elements)  # This node will retrieve a host element from hosted element. Ex. feed in door, get wall.
uniqueItems = List.UniqueItems(get_host_element)

# group: OPTION 1 - ELEMENT PARAMETERS
code_block = CodeBlock { "Type"; }
getParameterValueByName = Element.GetParameterValueByName(element=uniqueItems, parameterName=code_block)
code_block_2 = CodeBlock { "Width"; }
getParameterValueByName_2 = Element.GetParameterValueByName(element=getParameterValueByName, parameterName=code_block_2)
code_block_3 = CodeBlock { "Volume"; }
getParameterValueByName_3 = Element.GetParameterValueByName(element=uniqueItems, parameterName=code_block_3)
code_block_4 = CodeBlock { "Type"; }
getParameterValueByName_4 = Element.GetParameterValueByName(element=select_model_elements, parameterName=code_block_4)
code_block_5 = CodeBlock { {"Width","Height"}; }
getParameterValueByName_5 = Element.GetParameterValueByName(element=getParameterValueByName_4, parameterName=code_block_5, lacing=CrossProduct)
mul = getParameterValueByName_5 * getParameterValueByName_5
code_block_6 = CodeBlock(wallArea=mul, Thickness=getParameterValueByName_2) { (wallArea*Thickness)/1000000000; }
addItemToFront = List.AddItemToFront(item=getParameterValueByName_3, list=code_block_6, lacing=Longest)
sum = Math.Sum(addItemToFront)

# group: OPTION 2 - ELEMENT SURFACES
select_model_element = DSModelElementSelection()  # 1 picked in the model
geometry = Element.Geometry(select_model_element)
volume = Solid.Volume(geometry)
geometry_2 = Element.Geometry(uniqueItems)
explode = Geometry.Explode(geometry_2@L1)
code_block_7 = CodeBlock { 4; }

area = Surface.Area(explode)
maximumItem = List.MaximumItem(area@L2, lacing=Longest)
indexOf = IndexOf(area, maximumItem, lacing=Longest)
getItemAtIndex = List.GetItemAtIndex(list=explode@L2, index=indexOf@L1)

# group (continued): OPTION 2 - ELEMENT SURFACES
perimeterCurves = Surface.PerimeterCurves(getItemAtIndex)
chop = List.Chop(list=perimeterCurves, lengths=code_block_7)

group_curves = Custom[Group Curves](Curves=perimeterCurves, lacing=Longest)  # This node will take any input of flat list of curves and group them into sublists containing "joinable" curves that is continous curves. They might form closed curves or open curves. Use PolyCurve.ByJoinedCurves to convert output groups of curves into single PolyCurves

# group (continued): OPTION 2 - ELEMENT SURFACES
byJoinedCurves = PolyCurve.ByJoinedCurves(group_curves)
byPatch = Surface.ByPatch(byJoinedCurves, lacing=Longest)
area_2 = Surface.Area(byPatch)
code_block_8 = CodeBlock(a=area_2, Thickness=getParameterValueByName_2) { a*Thickness; }

getHost = FamilyInstance.GetHost(select_model_elements)
