# Dynamo graph WallsColouring03.dyn (Dynamo 1.3.0.875)

get_revit_activeview = Custom[Get Revit ActiveView]()  # Active View
select_model_elements = DSModelElementsSelection()  # 3 picked in the model
faces = Element.Faces(select_model_elements)
area = Surface.Area(faces)
maximumItem = List.MaximumItem(area)
eq = area == maximumItem
filterByBoolMask = List.FilterByBoolMask(list=faces, mask=eq)
flatten = Flatten(filterByBoolMask.in)
code_block = CodeBlock { 10; }

# group: V subdivisions
code_block_2 = CodeBlock(a=code_block) { 0..1..#a; }

# group: H subdivisions
code_block_3 = CodeBlock { 10; }

code_block_4 = CodeBlock(b=code_block_3) { (0..0.125..#b); (0.875..1..#b); (0.125..0.250..#b); (0.750..0.875..#b); (0.25..0.75..#b); }
code_block_5 = CodeBlock(a=code_block_4.out0, b=code_block_4.out1, c=code_block_4.out2, d=code_block_4.out3, e=code_block_4.out4) { {a,b,c,d,e}; }
flatten_2 = Flatten(code_block_5)
pointAtParameter = Surface.PointAtParameter(surface=flatten, u=code_block_2, v=flatten_2, lacing=CrossProduct)
transpose = List.Transpose(pointAtParameter, lacing=Longest)
flatten_3 = Flatten(transpose)
code_block_6 = CodeBlock { {1,1,2,2,4,1,1,2,2,4}; }
code_block_7 = CodeBlock(a=code_block, b=code_block_3) { a*b; }
cycle = List.Cycle(list=code_block_6, amount=code_block_7, lacing=Longest)
flatten_4 = Flatten(cycle)
count = List.Count(select_model_elements)
cycle_2 = List.Cycle(list=flatten_4, amount=count)
code_block_8 = CodeBlock { "Penetration Zoning"; "Red No, Orange TBC"; null; }
byViewPointsAndValues = Revit.AnalysisDisplay.PointAnalysisDisplay.ByViewPointsAndValues(get_revit_activeview, flatten_3, cycle_2, code_block_8.out0, code_block_8.out1, code_block_8.out2)
wall_penetration_zones = Custom[Wall Penetration Zones]()  # Identify the zones where penetration can be placed; unwired: element, H_Subdivisions, V_Subdivisions
