# Dynamo graph bb04ae2e7a06cc468d55248f3508789743139d0c.dyn (Dynamo 1.0.0.1180)

categories = Categories("StructuralFraming")
all_elements_of_category = ElementsOfCategory(categories)

# group: CLOCKWORK
location = Custom[Element.Location](element=all_elements_of_category)  # Returns the location of an element as an XYZ (or if it's line-based the start and end point of the line), along with some booleans to help filtering the results. Use this for some element types (e.g. walls or lines) that do not work with the built-in Get Family Instance Location node.

# group: Archi-Lab
group_curves = Custom[Group Curves](Curves=location.curves)  # This node will take any input of flat list of curves and group them into sublists containing "joinable" curves that is continous curves. They might form closed curves or open curves. Use PolyCurve.ByJoinedCurves to convert output groups of curves into single PolyCurves

equals = Equals(location.curves, group_curves, lacing=CrossProduct)
allFalse = AllFalse()
map = List.Map(f_x=allFalse)
map_2 = List.Map(list=equals, f_x=map)
code_block = CodeBlock { false; }
indexOf = IndexOf(map_2, code_block, lacing=Longest)
groupByKey = List.GroupByKey(list=all_elements_of_category, keys=indexOf)
watch = Watch(groupByKey.groups)
