# Dynamo graph beamEndPoints01.dyn (Dynamo 2.0.1.5055)

current = Document.Current()
activeView = Document.ActiveView(document=current)
select_model_element = DSModelElementSelection()  # 1 picked in the model
code_block = CodeBlock(a=select_model_element) { [a]; }
boolean = BoolSelector(false)
python_script = Python(IN[0]=code_block, IN[1]=boolean)
# ---------- python_script.python (80 lines) ----------
import clr

clr.AddReference('RevitAPI')
from Autodesk.Revit.DB import *
from Autodesk.Revit.DB.Structure import *

clr.AddReference('RevitAPIUI')
from Autodesk.Revit.UI import *

clr.AddReference('System')
from System.Collections.Generic import List

clr.AddReference('RevitNodes')
import Revit
clr.ImportExtensions(Revit.GeometryConversion)
clr.ImportExtensions(Revit.Elements)

clr.AddReference('RevitServices')
import RevitServices
from RevitServices.Persistence import DocumentManager
from RevitServices.Transactions import TransactionManager

doc = DocumentManager.Instance.CurrentDBDocument
uidoc=DocumentManager.Instance.CurrentUIApplication.ActiveUIDocument


def LeftMostEnd(beam):
	try:
		stPt = beam.Location.Curve.GetEndPoint(0).ToPoint()
		endPt = beam.Location.Curve.GetEndPoint(1).ToPoint()
		leftMostPoint = None
		if stPt.X == endPt.X:
			if stPt.Y < endPt.Y:
				leftMostPoint = stPt
			else:
				leftMostPoint = endPt
		elif stPt.X < endPt.X:
			leftMostPoint = stPt
		else:
			leftMostPoint = endPt
		return leftMostPoint
	except:
		return "Uh-oh something went wrong"

ele = UnwrapElement(IN[0])

openingCuts = FilteredElementCollector(doc).OfCategory(BuiltInCategory.OST_StructuralFramingOpening)


def FindOpeningCut(beam):
	openingCuts = FilteredElementCollector(doc).OfCategory(BuiltInCategory.OST_StructuralFramingOpening)
	return [o for o in openingCuts if o.Host.Id == beam.Id]
	
	
def CutElement(opening):
	for o in openig:
		ElementTransformUtils.CopyElement(doc, o.Id, XYZ(0,0,0))
	

def BBoxOrigin(bbox):
	return (bbox.Max - bbox.Min)/2
	

TransactionManager.Instance.EnsureInTransaction(doc)

ope = FindOpeningCut(ele[0])

bbox = []

for o in ope:
	bbox.append(o.get_BoundingBox(doc.ActiveView))

StructuralFramingUtils.FlipEnds(ele[0])

for o,b in zip(ope,bbox):
	ElementTransformUtils.MoveElement(doc, o.Id, BBoxOrigin(b))

TransactionManager.Instance.TransactionTaskDone()

OUT = FindOpeningCut(ele[0]), bbox
# ----------------------------------------
code_block_2 = CodeBlock { "1"; }
code_block_3 = CodeBlock { "Center"; }
byLocation = TextNote.ByLocation(location=python_script, text=code_block_2, alignment=code_block_3, lacing=Longest)  # unwired: view
select_model_elements = DSModelElementsSelection()  # 5 picked in the model
python_script_2 = Python(IN[0]=code_block, IN[1]=boolean)  # frozen
# ---------- python_script_2.python (74 lines) ----------
import clr

clr.AddReference('RevitAPI')
from Autodesk.Revit.DB import *
from Autodesk.Revit.DB.Structure import *

clr.AddReference('RevitAPIUI')
from Autodesk.Revit.UI import *

clr.AddReference('System')
from System.Collections.Generic import List

clr.AddReference('RevitNodes')
import Revit
clr.ImportExtensions(Revit.GeometryConversion)
clr.ImportExtensions(Revit.Elements)

clr.AddReference('RevitServices')
import RevitServices
from RevitServices.Persistence import DocumentManager
from RevitServices.Transactions import TransactionManager

doc = DocumentManager.Instance.CurrentDBDocument
uidoc=DocumentManager.Instance.CurrentUIApplication.ActiveUIDocument


def LeftMostEnd(beam):
	try:
		stPt = beam.Location.Curve.GetEndPoint(0).ToPoint()
		endPt = beam.Location.Curve.GetEndPoint(1).ToPoint()
		leftMostPoint = None
		if stPt.X == endPt.X:
			if stPt.Y < endPt.Y:
				leftMostPoint = stPt
			else:
				leftMostPoint = endPt
		elif stPt.X < endPt.X:
			leftMostPoint = stPt
		else:
			leftMostPoint = endPt
		return leftMostPoint
	except:
		return "Uh-oh something went wrong"

ele = UnwrapElement(IN[0])

openingCuts = FilteredElementCollector(doc).OfCategory(BuiltInCategory.OST_StructuralFramingOpening)


def FindOpeningCut(beam):
	openingCuts = FilteredElementCollector(doc).OfCategory(BuiltInCategory.OST_StructuralFramingOpening)
	return [o for o in openingCuts if o.Host.Id == beam.Id]
	
	
def CutElement(opening):
	for o in openig:
		ElementTransformUtils.CopyElement(doc, o.Id, XYZ(0,0,0))
	

def BBoxOrigin(bbox):
	return (bbox.Max - bbox.Min)/2
	

TransactionManager.Instance.EnsureInTransaction(doc)


newBeam = ElementTransformUtils.CopyElement(doc, ele[0].Id, XYZ(0,0,0))
StructuralFramingUtils.FlipEnds(doc.GetElement(newBeam[0]))
doc.Delete(ele[0].Id)


TransactionManager.Instance.TransactionTaskDone()

OUT = newBeam
# ----------------------------------------
