# Dynamo graph beamEndPoints02.dyn (Dynamo 2.0.1.5055)

select_model_elements = DSModelElementsSelection()  # 85 picked in the model
boolean = BoolSelector(false)
python_script = Python(IN[0]=select_model_elements, IN[1]=boolean)
# ---------- python_script.python (80 lines) ----------
import clr

clr.AddReference('RevitAPI')
from Autodesk.Revit.DB import *
from Autodesk.Revit.DB.Structure import *

clr.AddReference('RevitAPIUI')
from Autodesk.Revit.UI import *

clr.AddReference('System')
from System.Collections.Generic import List

clr.AddReference('RevitNodes')
import Revit
clr.ImportExtensions(Revit.GeometryConversion)
clr.ImportExtensions(Revit.Elements)

clr.AddReference('RevitServices')
import RevitServices
from RevitServices.Persistence import DocumentManager
from RevitServices.Transactions import TransactionManager

doc = DocumentManager.Instance.CurrentDBDocument
uidoc=DocumentManager.Instance.CurrentUIApplication.ActiveUIDocument


def LeftMostEnd(beam):
	try:
		stPt = beam.Location.Curve.GetEndPoint(0).ToPoint()
		endPt = beam.Location.Curve.GetEndPoint(1).ToPoint()
		leftMostPoint = None
		if stPt.X == endPt.X:
			if stPt.Y < endPt.Y:
				leftMostPoint = stPt
			else:
				leftMostPoint = endPt
		elif stPt.X < endPt.X:
			leftMostPoint = stPt
		else:
			leftMostPoint = endPt
		return leftMostPoint
	except:
		return "Uh-oh something went wrong"

def BeamsOnly(beam):
	return [b for b in inputs if b.Category.Name == "Structural Framing"]

if isinstance(IN[0], list):
	inputs = UnwrapElement(IN[0])
else:
	inputs = [UnwrapElement(IN[0])]



beams = BeamsOnly(inputs)

	
flip = []

TransactionManager.Instance.EnsureInTransaction(doc)

for b in beams:
	try:
		p = b.LookupParameter("Start Join Cutback")
		p.Set(20/304.8)
		p = b.LookupParameter("End Join Cutback")
		p.Set(20/304.8)
	except:
		continue

for b in beams:
	if LeftMostEnd(b) != b.Location.Curve.GetEndPoint(0).ToPoint():
		StructuralFramingUtils.FlipEnds(b)
		flip.append("Flipped")
	else:
		flip.append("Not Flipped")

TransactionManager.Instance.TransactionTaskDone()

OUT = flip
# ----------------------------------------
