# Dynamo graph blubeamMarkups.dyn (Dynamo 2.0.1.5055)

file_path = Filename("\\global.arup.com\australasia\MEL\Projects\249000\249616-00 ACU Building 115B\Work\Internal\BIM_CDE\00_WORKING\02_STRUCTURE\09_QA\01 Drafting To Do\20190130_CM review set 1.txt")
importCSV = Data.ImportCSV(filePath=file_path)
flatten = List.Flatten(list=importCSV)
code_block = CodeBlock { 4..192..6; }
getItemAtIndex = List.GetItemAtIndex(list=flatten, index=code_block)
code_block_2 = CodeBlock { "249616-ARP-DR-"; }
code_block_3 = CodeBlock { ""; }
replace = String.Replace(str=getItemAtIndex, searchFor=code_block_2, replaceWith=code_block_3)
string_from_array = FromArray(arr=replace)
watch = Custom[Springs.Watch+](input=string_from_array)  # This node that serializes the input information and presents it in a resizable text window.
