# Dynamo graph boundingBox.dyn (Dynamo 2.0.1.4955)

all_elements_in_active_view = ElementsInView()
type = Object.Type()  # unwired: obj
groupByFunction = List.GroupByFunction(list=all_elements_in_active_view, func=type)
code_block = CodeBlock(a=groupByFunction) { a[1]; }
boundingBox = Element.BoundingBox(element=code_block)
firstItem = List.FirstItem(list=groupByFunction)
code_block_2 = CodeBlock { -1; }
dropItems = List.DropItems(list=firstItem, amount=code_block_2)
getElementsIntersect = Revit.BoundingBox.GetElementsIntersect(boundingBox=boundingBox, elements=dropItems)
name = Element.Name(element=getElementsIntersect)
code_block_3 = CodeBlock { "z Offset Value"; }
getParameterValueByName = Element.GetParameterValueByName(element=code_block, parameterName=code_block_3)
code_block_4 = CodeBlock { "Height Offset From Level"; }
getParameterValueByName_2 = Element.GetParameterValueByName(element=getElementsIntersect, parameterName=code_block_4)
minimumItem = List.MinimumItem(list=getParameterValueByName_2)
code_block_5 = CodeBlock(a=getParameterValueByName, b=minimumItem) { a-b; }
code_block_6 = CodeBlock { -140; }
eq = code_block_5 == code_block_6
filterByBoolMask = List.FilterByBoolMask(list=code_block, mask=eq)
boolean = BoolSelector(false)
python_script = Python(IN[0]=filterByBoolMask.out, IN[1]=boolean)
# ---------- python_script.python (40 lines) ----------
import clr

clr.AddReference('RevitAPI')
from Autodesk.Revit.DB import *
from Autodesk.Revit.DB.Structure import *

clr.AddReference('RevitAPIUI')
from Autodesk.Revit.UI import *

clr.AddReference('System')
from System.Collections.Generic import List
from System.Collections.Generic import ICollection

clr.AddReference('RevitNodes')
import Revit
clr.ImportExtensions(Revit.GeometryConversion)
clr.ImportExtensions(Revit.Elements)

clr.AddReference('RevitServices')
import RevitServices
from RevitServices.Persistence import DocumentManager
from RevitServices.Transactions import TransactionManager

doc = DocumentManager.Instance.CurrentDBDocument
uidoc=DocumentManager.Instance.CurrentUIApplication.ActiveUIDocument

#Preparing input from dynamo to revit
element = UnwrapElement(IN[0])

refresh = IN[1]

selElements = uidoc.Selection

highlight = [element.Id]

Icollection = List[ElementId](highlight)

selElements.SetElementIds(Icollection)

OUT = 0
# ----------------------------------------
