# Dynamo graph calatrava1.dyn (Dynamo 1.3.3.4651)

# group: Crown Height (Corner of Crown)
number_slider = DoubleSlider(12, range=8..20 step 1)

# group: Column Height (Centre of Crown)
number_slider_2 = DoubleSlider(0.7, range=0..100 step 0.1)
code_block = CodeBlock(crownHeight=number_slider, deltaHeight=number_slider_2) { crownHeight-deltaHeight; }
code_block_2 = CodeBlock(ColumnHeight=code_block) { Point.ByCoordinates(0,0,ColumnHeight); }

# group: Half Crown Width
integer_slider = IntegerSlider(6, range=4..25 step 1)

byCorner = Custom[Rectangle.ByCorner](origin=code_block_2, halfCrownWidth=integer_slider)

# group: Construction Line for Rib
byStartPointEndPoint = Line.ByStartPointEndPoint(startPoint=code_block_2, endPoint=byCorner.CornerPoint)

# group: Rise of Ribs
number_slider_3 = DoubleSlider(0.6, range=0..100 step 0.1)

# group: Rib end point
number_slider_4 = DoubleSlider(1, range=0..1 step 0.1)

# group: Rib
code_block_3 = CodeBlock { 0.5; }
pointAtParameter = Curve.PointAtParameter(curve=byStartPointEndPoint, param=code_block_3)
translate = Geometry.Translate(geometry=pointAtParameter, zTranslation=number_slider_3)
pointAtParameter_2 = Curve.PointAtParameter(curve=byStartPointEndPoint, param=number_slider_4)
byThreePoints = Arc.ByThreePoints(firstPoint=code_block_2, secondPoint=translate, thirdPoint=pointAtParameter_2)

# group: Rib start point
number_slider_5 = DoubleSlider(0.1, range=0..1 step 0.1)

# group: Diagonal start point
pointAtParameter_3 = Curve.PointAtParameter(curve=byThreePoints, param=number_slider_5)

# group: Crown Heigth Mid Span
number_slider_6 = DoubleSlider(1, range=0..1 step 0.1)

# group: Crown Mid Points
translate_2 = Geometry.Translate(geometry=byCorner.MidSpanPoints, zTranslation=number_slider_6)

# group: Primary Beams (Diagonals)
byStartPointEndPoint_2 = Line.ByStartPointEndPoint(startPoint=pointAtParameter_3, endPoint=translate_2)

# group: Edge arcs
YAxis = Vector.YAxis()
XAxis = Vector.XAxis()
create = List.Create(YAxis, XAxis)
byStartPointEndPointStartTangent = Arc.ByStartPointEndPointStartTangent(translate_2, pointAtParameter_2, create)

splitByPoints = Curve.SplitByPoints(curve=byThreePoints, points=pointAtParameter_3)
deconstruct = List.Deconstruct(list=splitByPoints)

# group: Number of secondary beams
integer_slider_2 = IntegerSlider(7, range=3..15 step 1)

code_block_4 = CodeBlock(a=integer_slider_2) { 1/a..1-1/a..#a; }
pointAtParameter_4 = Curve.PointAtParameter(curve=deconstruct.rest@L1, param=code_block_4)
pointAtParameter_5 = Curve.PointAtParameter(curve=byStartPointEndPointStartTangent@L1, param=code_block_4)
byStartPointEndPoint_3 = Line.ByStartPointEndPoint(startPoint=pointAtParameter_4, endPoint=pointAtParameter_5, lacing=Longest)
create_2 = List.Create(byStartPointEndPoint_2, byStartPointEndPointStartTangent, byStartPointEndPoint_3, byThreePoints)
flatten = Flatten(create_2)
origin = Point.Origin()
ZAxis = Vector.ZAxis()
code_block_5 = CodeBlock { {90,180,270}; }
rotate = Geometry.Rotate(geometry=flatten, origin=origin, axis=ZAxis, degrees=code_block_5, lacing=CrossProduct)
origin_2 = Point.Origin()
ZAxis_2 = Vector.ZAxis()
byStartPointEndPointStartTangent_2 = Arc.ByStartPointEndPointStartTangent(origin_2, translate_2, ZAxis_2)

# group: Trunk fork position
number_slider_7 = DoubleSlider(0.6, range=0..1 step 0.1)

pointAtParameter_6 = Curve.PointAtParameter(curve=byStartPointEndPointStartTangent_2, param=number_slider_7)
byStartPointEndPoint_4 = Line.ByStartPointEndPoint(startPoint=pointAtParameter_6, endPoint=code_block_2)
create_3 = List.Create(byStartPointEndPoint_4, byStartPointEndPointStartTangent_2)
origin_3 = Point.Origin()
byThreePoints_2 = Plane.ByThreePoints(code_block_2, origin_3, byCorner.CornerPoint)
XY = Plane.XY()
code_block_6 = CodeBlock { 90; }
rotate_2 = Geometry.Rotate(byThreePoints_2, XY, code_block_6)
mirror = Geometry.Mirror(geometry=create_3, mirrorPlane=rotate_2)
