# Dynamo graph castInPlates.dyn (Dynamo 2.1.0.5696)

select_model_element = DSModelElementSelection()  # 1 picked in the model
all_elements_in_active_view = ElementsInView()

# group: get walls and beams only
python_script = Python(IN[0]=all_elements_in_active_view)
# ---------- python_script.python (42 lines) ----------
import clr

clr.AddReference('RevitAPI')
from Autodesk.Revit.DB import *
from Autodesk.Revit.DB.Structure import *

clr.AddReference('RevitAPIUI')
from Autodesk.Revit.UI import *

clr.AddReference('System')
from System.Collections.Generic import List

clr.AddReference('RevitNodes')
import Revit
clr.ImportExtensions(Revit.GeometryConversion)
clr.ImportExtensions(Revit.Elements)

clr.AddReference('RevitServices')
import RevitServices
from RevitServices.Persistence import DocumentManager
from RevitServices.Transactions import TransactionManager

doc = DocumentManager.Instance.CurrentDBDocument
uidoc=DocumentManager.Instance.CurrentUIApplication.ActiveUIDocument


def GetEndPoints(beam):
	return [beam.Location.Curve.GetEndPoint(0).ToPoint(), beam.Location.Curve.GetEndPoint(1).ToPoint()]

#Preparing input from dynamo to revit
elements = UnwrapElement(IN[0])
walls = []
beams = []

for e in elements:
	if e.Category.Name == "Walls":
		walls.append(e)
	if e.Category.Name == "Structural Framing":
		endPts = GetEndPoints(e)
		beams.append([e, endPts])
	
OUT = walls, beams
# ----------------------------------------

code_block = CodeBlock(a=python_script) { a[0]; }
boundingBox = Element.BoundingBox(element=code_block)
select_face = DSFaceSelection()  # 1 picked in the model
byGeometry = BoundingBox.ByGeometry(geom=select_face)
getElementsIntersect = Revit.BoundingBox.GetElementsIntersect(boundingBox=byGeometry)  # unwired: elements
code_block_2 = CodeBlock(a=getElementsIntersect) { a[0]; }
code_block_3 = CodeBlock(a=code_block_2) { a[22]; }
boolean = BoolSelector(true)
code_block_4 = CodeBlock(a=python_script) { a[1]; }
code_block_5 = CodeBlock { 1; }
getItemAtIndex = List.GetItemAtIndex(list=code_block_4, index=code_block_5, lacing=Longest)
distanceTo = Geometry.DistanceTo(geometry=select_face, other=getItemAtIndex, lacing=CrossProduct)
code_block_6 = CodeBlock { 500; }
lt = distanceTo < code_block_6
countTrue = List.CountTrue(list=lt, lacing=Longest)
code_block_7 = CodeBlock { 0; }
getItemAtIndex_2 = List.GetItemAtIndex(list=code_block_4, index=code_block_7, lacing=Longest)
code_block_8 = CodeBlock { true; }
allIndicesOf = List.AllIndicesOf(list=lt@L2, item=code_block_8, lacing=CrossProduct)
isEmpty = List.IsEmpty(list=allIndicesOf, lacing=Longest)
filterByBoolMask = List.FilterByBoolMask(list=getItemAtIndex_2, mask=isEmpty)
select_model_element_2 = DSModelElementSelection()  # 1 picked in the model
python_script_2 = Python()  # unwired: IN[0]
# ---------- python_script_2.python (41 lines) ----------
#Copyright(c) 2016, Dimitar Venkov
# @5devene, dimitar.ven@gmail.com

import clr

clr.AddReference("RevitAPIUI")
from  Autodesk.Revit.UI import *

clr.AddReference("RevitServices")
import RevitServices
from RevitServices.Persistence import DocumentManager
doc = DocumentManager.Instance.CurrentDBDocument
uidoc=DocumentManager.Instance.CurrentUIApplication.ActiveUIDocument

clr.AddReference("RevitNodes")
import Revit
clr.ImportExtensions(Revit.Elements)
clr.ImportExtensions(Revit.GeometryConversion)

clr.AddReference('RevitAPI')
from Autodesk.Revit.DB import *

def output1(x):
	if len(x) == 1: return x[0]
	else : return x

surfaces = []
sel1 = uidoc.Selection
ot1 = Selection.ObjectType.Face
ref_list = sel1.PickObjects(ot1, "Select the faces and press Finish.")
for ref in ref_list:
	el1 = doc.GetElement(ref.ElementId)
	sf0 = el1.GetGeometryObjectFromReference(ref)
	if isinstance(el1, FamilyInstance):
		tf1 = el1.GetTransform().ToCoordinateSystem()
		sf1 = sf0.Convert(ref, tf1)
	else:
		sf1 = sf0
	surfaces.append(sf1)

OUT = surfaces
# ----------------------------------------
family_types = FamilyTypes(index=908)
python_script_3 = Python(IN[0]=select_model_element_2, IN[1]=python_script_2, IN[2]=family_types)
# ---------- python_script_3.python (72 lines) ----------
import clr

clr.AddReference('RevitAPI')
from Autodesk.Revit.DB import *
from Autodesk.Revit.DB.Structure import *

clr.AddReference('RevitAPIUI')
from Autodesk.Revit.UI import *

clr.AddReference('System')
from System.Collections.Generic import List

clr.AddReference('RevitNodes')
import Revit
clr.ImportExtensions(Revit.GeometryConversion)
clr.ImportExtensions(Revit.Elements)

clr.AddReference('RevitServices')
import RevitServices
from RevitServices.Persistence import DocumentManager
from RevitServices.Transactions import TransactionManager

doc = DocumentManager.Instance.CurrentDBDocument
uidoc=DocumentManager.Instance.CurrentUIApplication.ActiveUIDocument


def BeamMidPoint(beam):
	#stPt = beam.Location.Curve.GetEndPoint(0)
	#endPt = beam.Location.Curve.GetEndPoint(0)
	return beam.Location.Curve.Evaluate(0.5,True)
	
def BeamDirection(beam):
	return beam.HandOrientation

def SignedDistanceTo(plane, p ):
	v = p - plane.Origin
	return plane.FaceNormal.DotProduct( v )
  
  
def ProjectOnto(plane, p):
	d = SignedDistanceTo(plane, p );
	q = p - d * plane.FaceNormal;
	return q;

if isinstance(IN[0], list):
	elements = UnwrapElement(IN[0])
else:
	elements = [UnwrapElement(IN[0])]


wallFace = IN[1][0]
beams = []
points = []
fs = UnwrapElement(IN[2]) #VOID FAMILY TYPE

TransactionManager.Instance.EnsureInTransaction(doc)

for e in elements:
	if e.Category.Name == "Structural Framing":
		check = BeamDirection(e).CrossProduct(wallFace.FaceNormal)
		upVector = XYZ(0,0,1)
		downVector = XYZ(0,0,-1)
		if not check.IsAlmostEqualTo(upVector) and not check.IsAlmostEqualTo(downVector):
			points.append(ProjectOnto(wallFace, BeamMidPoint(e)))
			beams.append(e)
			#void = doc.Create.NewFamilyInstance.Overloads[Reference, XYZ, XYZ, FamilySymbol](wallFace.Reference, transformedPoint, direction, fs);

TransactionManager.Instance.TransactionTaskDone()

pt = XYZ(0,0,0)

OUT = points[0].ToPoint()
# ----------------------------------------
boolean_2 = BoolSelector(false)
selectInRevit = Custom[Springs.SelectInRevit](element=python_script_3, reset=boolean_2)  # Selects the input elements inside the Revit UI.
XAxis = Vector.XAxis()
reverse = Vector.Reverse(vector=XAxis)
byFace = FamilyInstance.ByFace(familyType=family_types, face=select_face, location=python_script_3, referenceDirection=reverse)
