# Dynamo graph changeOpeningType.dyn (Dynamo 2.0.1.5055)

select_model_elements = DSModelElementsSelection()  # 4 picked in the model
code_block = CodeBlock(a=select_model_elements) { a; }  # frozen
code_block_2 = CodeBlock { "Type"; }
family_types = FamilyTypes(index=378)
setParameterByName = Element.SetParameterByName(element=code_block, parameterName=code_block_2, value=family_types, lacing=Longest)
code_block_3 = CodeBlock { "P_Distance from Start"; }
code_block_4 = CodeBlock { "P_Distance from Start"; }
getParameterValueByName = Element.GetParameterValueByName(element=code_block, parameterName=code_block_4)
setParameterByName_2 = Element.SetParameterByName(element=setParameterByName, parameterName=code_block_3, value=getParameterValueByName, lacing=Longest)
family_types_2 = FamilyTypes(index=378)
python_script = Python(IN[0]=select_model_elements, IN[1]=family_types_2)
# ---------- python_script.python (45 lines) ----------
import clr
clr.AddReference('RevitAPI')
from Autodesk.Revit.DB import *

clr.AddReference("RevitNodes")
import Revit
clr.ImportExtensions(Revit.Elements)

clr.AddReference("RevitServices")
import RevitServices
from RevitServices.Persistence import DocumentManager
from RevitServices.Transactions import TransactionManager


def GetParVal(element, paramName):
	for p in element.Parameters:
			if p.Definition.Name == paramName:
				value = p.AsDouble()
	return value
	
def SetParVal(element, paramName, value):
	for p in element.Parameters:
		if p.Definition.Name == paramName:
			p.Set(value)
	
doc = DocumentManager.Instance.CurrentDBDocument
faminsts = UnwrapElement(IN[0])
famsymb = UnwrapElement(IN[1])
booleans = []
counter = 0

TransactionManager.Instance.EnsureInTransaction(doc)
for item in faminsts:
	try:
		distance = GetParVal(item, "P_Distance from Start")
		item.Symbol = famsymb
		p = item.LookupParameter("P_Distance from Start")
		p.Set(distance)
		booleans.append(True)
	except:
		booleans.append(False)
	counter += 1
TransactionManager.Instance.TransactionTaskDone()

OUT = (faminsts,booleans)
# ----------------------------------------
