# Dynamo graph classExampleGrids.dyn (Dynamo 1.3.2.2480)

code_block = CodeBlock { "3Ca"; }
code_block_2 = CodeBlock { {"3D","4D"}; }
python_script = Python(IN[0]=code_block, IN[1]=code_block_2)
# ---------- python_script.python (11 lines) ----------
import clr
clr.AddReference('ProtoGeometry')
from Autodesk.DesignScript.Geometry import *
#The inputs to this node will be stored as a list in the IN variables.
dataEnteringNode = IN

vGrids = IN[0]
hGrids = IN[1]

#Assign your output to the OUT variable.
OUT = int(filter(str.isdigit, vGrids))
# ----------------------------------------
code_block_3 = CodeBlock { 1..5; }
code_block_4 = CodeBlock { "a".."f"; }
code_block_5 = CodeBlock { 0..5; }
byCoordinates = Point.ByCoordinates(x=code_block_3, y=code_block_5, lacing=CrossProduct)
flatten = Flatten(byCoordinates)
python_script_2 = Python(IN[0]=code_block_3, IN[1]=code_block_4, IN[2]=flatten)
# ---------- python_script_2.python (28 lines) ----------
import clr
clr.AddReference('ProtoGeometry')
from Autodesk.DesignScript.Geometry import *
#The inputs to this node will be stored as a list in the IN variables.
class GridPoint:
	def __init__(self,pt,name,v,h):
		self.Point = pt
		self.Name = name
		self.vGrid = v
		self.hGrid = h
	
	def printOut(self):
		return [self.Point, self.Name, self.vGrid, self.hGrid]
	
		pass

list= []

for vGrid in IN[0]:
	for hGrid in IN[1]:
		instance = GridPoint(None, str(vGrid)+str(hGrid),vGrid, hGrid)
		list.append(instance)

for l,p in zip(list, IN[2]):
	l.Point = p
	
#Assign your output to the OUT variable.
OUT = list
# ----------------------------------------
python_script_3 = Python(IN[0]=python_script_2)
# ---------- python_script_3.python (8 lines) ----------
import clr
clr.AddReference('ProtoGeometry')
from Autodesk.DesignScript.Geometry import *
#The inputs to this node will be stored as a list in the IN variables.
dataEnteringNode = IN

#Assign your output to the OUT variable.
OUT = [g.Name for g in IN[0]]
# ----------------------------------------
python_script_4 = Python()  # unwired: IN[0]
# ---------- python_script_4.python (38 lines) ----------
import clr
clr.AddReference('ProtoGeometry')
from Autodesk.DesignScript.Geometry import *

"""

pt = Point.ByCoordinates(0,0)
instance = GridPoint(pt, "1A", 1, "A")

class GridPoint:
	pass

instance = Gp()
instance.pt = Point.ByCoordinates(0,0)
instance.Name = "1A"

class GridPoint:
	def __init__(self):
		self.Point = None
		self.Name = None
		self.vGrid = None
		self.hGrid = None
"""

class GridPoint:
	def __init__(self, point, name, vGrid, hGrid):
		self.pt = point
		self.n = name
		self.vG = vGrid
		self.hG = hGrid


instance = GridPoint(Point.ByCoordinates(0,0),"1A","1","A")


instance.Name = "2b"
#Assign your output to the OUT variable.
OUT = instance
# ----------------------------------------
python_script_5 = Python(IN[0]=python_script_4)
# ---------- python_script_5.python (10 lines) ----------
import clr
clr.AddReference('ProtoGeometry')
from Autodesk.DesignScript.Geometry import *





#Assign your output to the OUT variable.
OUT = IN[0].Name
# ----------------------------------------
python_script_6 = Python(IN[0]=python_script_2)
# ---------- python_script_6.python (8 lines) ----------
import clr
clr.AddReference('ProtoGeometry')
from Autodesk.DesignScript.Geometry import *
#The inputs to this node will be stored as a list in the IN variables.
dataEnteringNode = IN

#Assign your output to the OUT variable.
OUT = [g.printOut() for g in IN[0]]
# ----------------------------------------
code_block_6 = CodeBlock(a=python_script_6) { a[0][3]; }
