# Dynamo graph closestGridPoint01.dyn (Dynamo 1.3.2.2480)

code_block = CodeBlock { 0..3; }
string_from_object = FromObject(code_block)
code_block_2 = CodeBlock { "a".."f"; }
add = string_from_object + code_block_2  # lacing=CrossProduct
flatten = Flatten(add)
code_block_3 = CodeBlock { Point.ByCoordinates(2.1,2.8); }
code_block_4 = CodeBlock { Point.ByCoordinates(3.1,2.8); }
code_block_5 = CodeBlock { 0..3; }
byCoordinates = Point.ByCoordinates(x=code_block_5)
code_block_6 = CodeBlock { 0..3; }
code_block_7 = CodeBlock { 10; }
byCoordinates_2 = Point.ByCoordinates(x=code_block_6, y=code_block_7)
byStartPointEndPoint = Line.ByStartPointEndPoint(startPoint=byCoordinates, endPoint=byCoordinates_2)
endPoints = Geometry.Curves.EndPoints(byStartPointEndPoint)
code_block_8 = CodeBlock(a=endPoints.out1) { a; }
code_block_9 = CodeBlock { 0..5; }
byCoordinates_3 = Point.ByCoordinates(y=code_block_9)
code_block_10 = CodeBlock { 10; }
code_block_11 = CodeBlock { 0..5; }
byCoordinates_4 = Point.ByCoordinates(x=code_block_10, y=code_block_11)
byStartPointEndPoint_2 = Line.ByStartPointEndPoint(startPoint=byCoordinates_3, endPoint=byCoordinates_4)
YAxis = Vector.YAxis()
reverse = Vector.Reverse(YAxis)
project = Point.Project(code_block_8, byStartPointEndPoint_2, reverse, lacing=CrossProduct)
flatten_2 = Flatten(project@L4)
flatten_3 = Flatten(flatten_2)
python_script = Python(IN[0]=flatten_3, IN[1]=flatten)
# ---------- python_script.python (21 lines) ----------
import clr
clr.AddReference('ProtoGeometry')
from Autodesk.DesignScript.Geometry import *
#The inputs to this node will be stored as a list in the IN variables.
class GridPoint():
	def __init__(self):
		self.Point = None
		self.Name = None
		pass

list= []

for point,name in zip(IN[0],IN[1]):
	instance = GridPoint()
	instance.Point = point
	instance.Name = name
	list.append(instance)


#Assign your output to the OUT variable.
OUT = list
# ----------------------------------------
python_script_2 = Python(IN[0]=python_script)
# ---------- python_script_2.python (12 lines) ----------
import clr
clr.AddReference('ProtoGeometry')
from Autodesk.DesignScript.Geometry import *
#The inputs to this node will be stored as a list in the IN variables.

list = []

for l in IN[0]:
	subout = l.Point
	list.append(subout)
	
OUT = list
# ----------------------------------------
join = List.Join(byStartPointEndPoint, byStartPointEndPoint_2)
join_2 = List.Join(code_block, code_block_2)
code_block_12 = CodeBlock { 0.5; }

# group: FInd closest grid
byStartPointEndPoint_3 = Line.ByStartPointEndPoint(startPoint=code_block_3, endPoint=code_block_4)
python_script_3 = Python(IN[0]=join, IN[1]=join_2)
# ---------- python_script_3.python (21 lines) ----------
import clr
clr.AddReference('ProtoGeometry')
from Autodesk.DesignScript.Geometry import *
#The inputs to this node will be stored as a list in the IN variables.
class Grid():
	def __init__(self):
		self.Line = None
		self.Name = None
		pass

list= []

for line,name in zip(IN[0],IN[1]):
	instance = Grid()
	instance.Line = line
	instance.Name = name
	list.append(instance)


#Assign your output to the OUT variable.
OUT = list
# ----------------------------------------
pointAtParameter = Curve.PointAtParameter(curve=byStartPointEndPoint_3, param=code_block_12)
python_script_4 = Python(IN[0]=python_script_3)
# ---------- python_script_4.python (12 lines) ----------
import clr
clr.AddReference('ProtoGeometry')
from Autodesk.DesignScript.Geometry import *
#The inputs to this node will be stored as a list in the IN variables.

list = []

for l in IN[0]:
	subout = l.Line
	list.append(subout)
	
OUT = list
# ----------------------------------------
distanceTo = Geometry.DistanceTo(geometry=pointAtParameter, other=python_script_4)

endPoints_2 = Geometry.Curves.EndPoints(byStartPointEndPoint_3)
code_block_13 = CodeBlock(a=endPoints_2.out0, b=endPoints_2.out1) { {a,b}; }
distanceTo_2 = Geometry.DistanceTo(geometry=code_block_13, other=python_script_2, lacing=CrossProduct)
minimumItem = List.MinimumItem(distanceTo_2)
allIndicesOf = List.AllIndicesOf(list=distanceTo_2, item=minimumItem, lacing=Longest)
getItemAtIndex = List.GetItemAtIndex(list=flatten, index=allIndicesOf)

# group: distance from grid
minimumItem_2 = List.MinimumItem(distanceTo)

# group (continued): FInd closest grid
allIndicesOf_2 = List.AllIndicesOf(list=distanceTo, item=minimumItem_2)
getItemAtIndex_2 = List.GetItemAtIndex(list=python_script_3, index=allIndicesOf_2)

# group: grid name
python_script_5 = Python(IN[0]=getItemAtIndex_2)
# ---------- python_script_5.python (12 lines) ----------
import clr
clr.AddReference('ProtoGeometry')
from Autodesk.DesignScript.Geometry import *
#The inputs to this node will be stored as a list in the IN variables.

list = []

for l in IN[0]:
	subout = l.Name
	list.append(subout)
	
OUT = list
# ----------------------------------------

# group: Beams
categories = Categories("StructuralFraming")
all_elements_of_category = ElementsOfCategory(categories)
location = StructuralFraming.Location(all_elements_of_category)

endPoints_3 = Geometry.Curves.EndPoints(location)

# group: VerticalGrids
select_model_elements = DSModelElementsSelection()  # 7 picked in the model

curve = Grid.Curve(select_model_elements)

# group: HorizontalGrids
select_model_elements_2 = DSModelElementsSelection()  # 4 picked in the model

curve_2 = Grid.Curve(select_model_elements_2)
findIntersections = Geometry.Intersection.FindIntersections(curve, curve_2)
flatten_4 = Flatten(findIntersections)
name = Element.Name(select_model_elements)
name_2 = Element.Name(select_model_elements_2)
add_2 = name + name_2  # lacing=CrossProduct
flatten_5 = Flatten(add_2)

# group: create grid intersection points
python_script_6 = Python(IN[0]=flatten_4, IN[1]=flatten_5)  # same code as python_script

# group: get the point xyz
python_script_7 = Python(IN[0]=python_script_6)  # same code as python_script_2

# group: Closest Grid point to Beam Start Point
code_block_14 = CodeBlock(a=endPoints_3.out0) { a; }
distanceTo_3 = Geometry.DistanceTo(geometry=code_block_14, other=python_script_7, lacing=CrossProduct)
minimumItem_3 = List.MinimumItem(distanceTo_3, lacing=Longest)
allIndicesOf_3 = List.AllIndicesOf(list=distanceTo_3, item=minimumItem_3, lacing=Longest)
getItemAtIndex_3 = List.GetItemAtIndex(list=python_script_6, index=allIndicesOf_3)
flatten_6 = Flatten(getItemAtIndex_3)
python_script_8 = Python(IN[0]=flatten_6)  # same code as python_script_5

# group: Closest Grid point to Beam End Point
code_block_15 = CodeBlock(a=endPoints_3.out1) { a; }
distanceTo_4 = Geometry.DistanceTo(geometry=code_block_15, other=python_script_7, lacing=CrossProduct)
minimumItem_4 = List.MinimumItem(distanceTo_4, lacing=Longest)
allIndicesOf_4 = List.AllIndicesOf(list=distanceTo_4, item=minimumItem_4, lacing=Longest)
getItemAtIndex_4 = List.GetItemAtIndex(list=python_script_6, index=allIndicesOf_4)
flatten_7 = Flatten(getItemAtIndex_4)
python_script_9 = Python(IN[0]=flatten_7)  # same code as python_script_5

max = Math.Max(value1=minimumItem_3, value2=minimumItem_4)
code_block_16 = CodeBlock { "Comments"; }
code_block_17 = CodeBlock(a=python_script_9, b=python_script_8) { a+"-"+b; }
python_script_10 = Python(IN[0]=code_block_17)
# ---------- python_script_10.python (10 lines) ----------
import re

def return_dupe(string):
    d = {}
    [d.update({k:2}) if k in d else d.update({k:1}) for k in string]
    return [key for key in d if d[key] > 1]
       

#Assign your output to the OUT variable.
OUT = [return_dupe(s) for s in IN[0]]
# ----------------------------------------
flatten_8 = Flatten(python_script_10)

# group: grid lines
join_3 = List.Join(curve, curve_2)

# group: grid names
join_4 = List.Join(name, name_2)

allIndicesOf_5 = List.AllIndicesOf(list=join_4, item=flatten_8)
getItemAtIndex_5 = List.GetItemAtIndex(list=join_3, index=allIndicesOf_5)
flatten_9 = Flatten(getItemAtIndex_5)
code_block_18 = CodeBlock { 0.5; }
pointAtParameter_2 = Curve.PointAtParameter(curve=location, param=code_block_18)
distanceTo_5 = Geometry.DistanceTo(geometry=flatten_9, other=pointAtParameter_2)
round = Math.Round(distanceTo_5)
python_script_11 = Python(IN[0]=round)
# ---------- python_script_11.python (5 lines) ----------
import clr


#Assign your output to the OUT variable.
OUT = [int(n) for n in IN[0]]
# ----------------------------------------
code_block_19 = CodeBlock { ""; }
replace = String.Replace(str=code_block_17, searchFor=python_script_10, replaceWith=code_block_19)
code_block_20 = CodeBlock(a=flatten_8, b=python_script_11, c=replace) { a+b+"/"+c; }
setParameterByName = Element.SetParameterByName(element=all_elements_of_category, parameterName=code_block_16, value=code_block_20)
