# Dynamo graph closestGridPoint02.dyn (Dynamo 1.3.2.2480)

# group: Beams
select_model_elements = DSModelElementsSelection()  # 128 picked in the model

code_block = CodeBlock { "Mark"; }

# group: VerticalGrids
select_model_elements_2 = DSModelElementsSelection()  # 8 picked in the model

curve = Grid.Curve(select_model_elements_2)

# group: HorizontalGrids
select_model_elements_3 = DSModelElementsSelection()  # 10 picked in the model

curve_2 = Grid.Curve(select_model_elements_3)
findIntersections = Geometry.Intersection.FindIntersections(curve, curve_2)
flatten = Flatten(findIntersections)
name = Element.Name(select_model_elements_2)
name_2 = Element.Name(select_model_elements_3)
add = name + name_2  # lacing=CrossProduct
flatten_2 = Flatten(add)

# group: create grid intersection points
python_script = Python(IN[0]=flatten, IN[1]=flatten_2)
# ---------- python_script.python (21 lines) ----------
import clr
clr.AddReference('ProtoGeometry')
from Autodesk.DesignScript.Geometry import *
#The inputs to this node will be stored as a list in the IN variables.
class GridPoint():
	def __init__(self):
		self.Point = None
		self.Name = None
		pass

list= []

for point,name in zip(IN[0],IN[1]):
	instance = GridPoint()
	instance.Point = point
	instance.Name = name
	list.append(instance)


#Assign your output to the OUT variable.
OUT = list
# ----------------------------------------

location = StructuralFraming.Location(select_model_elements)
endPoints = Geometry.Curves.EndPoints(location)

# group: get the point xyz
python_script_2 = Python(IN[0]=python_script)
# ---------- python_script_2.python (12 lines) ----------
import clr
clr.AddReference('ProtoGeometry')
from Autodesk.DesignScript.Geometry import *
#The inputs to this node will be stored as a list in the IN variables.

list = []

for l in IN[0]:
	subout = l.Point
	list.append(subout)
	
OUT = list
# ----------------------------------------

# group: Closest Grid point to Beam Start Point
code_block_2 = CodeBlock(a=endPoints.out0) { a; }
distanceTo = Geometry.DistanceTo(geometry=code_block_2, other=python_script_2, lacing=CrossProduct)
minimumItem = List.MinimumItem(distanceTo, lacing=Longest)
allIndicesOf = List.AllIndicesOf(list=distanceTo, item=minimumItem, lacing=Longest)
getItemAtIndex = List.GetItemAtIndex(list=python_script, index=allIndicesOf)
flatten_3 = Flatten(getItemAtIndex)
python_script_3 = Python(IN[0]=flatten_3)
# ---------- python_script_3.python (12 lines) ----------
import clr
clr.AddReference('ProtoGeometry')
from Autodesk.DesignScript.Geometry import *
#The inputs to this node will be stored as a list in the IN variables.

list = []

for l in IN[0]:
	subout = l.Name
	list.append(subout)
	
OUT = list
# ----------------------------------------

# group: Closest Grid point to Beam End Point
code_block_3 = CodeBlock(a=endPoints.out1) { a; }
distanceTo_2 = Geometry.DistanceTo(geometry=code_block_3, other=python_script_2, lacing=CrossProduct)
minimumItem_2 = List.MinimumItem(distanceTo_2, lacing=Longest)
allIndicesOf_2 = List.AllIndicesOf(list=distanceTo_2, item=minimumItem_2, lacing=Longest)
getItemAtIndex_2 = List.GetItemAtIndex(list=python_script, index=allIndicesOf_2)
flatten_4 = Flatten(getItemAtIndex_2)
python_script_4 = Python(IN[0]=flatten_4)  # same code as python_script_3

python_script_5 = Python(IN[0]=python_script_3, IN[1]=python_script_4)
# ---------- python_script_5.python (22 lines) ----------
import clr

vGrids = IN[0]
hGrids = IN[1]

newList = []

for vG,hG in zip(vGrids,hGrids):
	if len(vG)<3:
		if vG[0] == hG[0]:
			newList.append(vG[0])
		else:
			newList.append(vG[1])
	else:
		if vG[0]+vG[1] == hG[0]+hG[1]:
			newList.append(vG[0]+vG[1])
		else:
			newList.append(vG[2])
 

#Assign your output to the OUT variable.
OUT = newList
# ----------------------------------------

# group: parallel grid names
flatten_5 = Flatten(python_script_5)

# group: grid lines
join = List.Join(curve, curve_2)

# group: grid names
join_2 = List.Join(name, name_2)

allIndicesOf_3 = List.AllIndicesOf(list=join_2, item=flatten_5)
getItemAtIndex_3 = List.GetItemAtIndex(list=join, index=allIndicesOf_3)
flatten_6 = Flatten(getItemAtIndex_3)
code_block_4 = CodeBlock { 0.5; }
pointAtParameter = Curve.PointAtParameter(curve=location, param=code_block_4)
XY = Plane.XY()
ZAxis = Vector.ZAxis()
reverse = Vector.Reverse(ZAxis)
project = Point.Project(pointAtParameter, XY, reverse)
flatten_7 = Flatten(project)
distanceTo_3 = Geometry.DistanceTo(geometry=flatten_6, other=flatten_7)
round = Math.Round(distanceTo_3)
python_script_6 = Python(IN[0]=round)
# ---------- python_script_6.python (5 lines) ----------
import clr


#Assign your output to the OUT variable.
OUT = [int(n) for n in IN[0]]
# ----------------------------------------
ZAxis_2 = Vector.ZAxis()

# group: vector perpendicular to line
direction = Line.Direction(flatten_6)
cross = Vector.Cross(vector=direction, cross=ZAxis_2)

python_script_7 = Python(IN[0]=python_script_6, IN[1]=flatten_6, IN[2]=pointAtParameter, IN[3]=cross)
# ---------- python_script_7.python (24 lines) ----------
import clr
clr.AddReference('ProtoGeometry')
from Autodesk.DesignScript.Geometry import *
#The inputs to this node will be stored as a list in the IN variables.

distances = IN[0]
gridLines = IN[1]
points = IN[2]
vectors = IN[3]

result = []

for i in range(0,len(distances)):
	if distances[i]>0:
		check = points[i].Project(gridLines[i],vectors[i])
		if not check:
			result.append(distances[i]*-1)
		else:
			result.append(distances[i]*1)
	else:
		result.append(distances[i])

#Assign your output to the OUT variable.
OUT = result
# ----------------------------------------
python_script_8 = Python(IN[0]=python_script_7)
# ---------- python_script_8.python (15 lines) ----------
import clr
clr.AddReference('ProtoGeometry')
from Autodesk.DesignScript.Geometry import *
#The inputs to this node will be stored as a list in the IN variables.

newList = []
for r in IN[0]:
	if r >0:
		newList.append("+"+str(r))
	else:
		newList.append(str(r))
	

#Assign your output to the OUT variable.
OUT = newList
# ----------------------------------------
code_block_5 = CodeBlock(a=python_script_4, b=python_script_3) { a+"-"+b; }

# group: perpendicular grids (2)
code_block_6 = CodeBlock { ""; }
replace = String.Replace(str=code_block_5, searchFor=flatten_5, replaceWith=code_block_6)

code_block_7 = CodeBlock(a=flatten_5, b=python_script_8, c=replace) { a+b+"/"+c; }
setParameterByName = Element.SetParameterByName(element=select_model_elements, parameterName=code_block, value=code_block_7)
