# Dynamo graph closestGridPoint03.dyn (Dynamo 2.0.2.6826)

# group: Beams
# note: Custom Node: Revit
select_model_elements = DSModelElementsSelection()  # nothing selected; graph input

code_block = CodeBlock { "Mark"; }

# group: VerticalGrids
# note: Custom Node: Revit
select_model_elements_2 = DSModelElementsSelection()  # 3 picked in the model; graph input

# note: Custom Node: Revit
curve = Grid.Curve(grid=select_model_elements_2)

# group: HorizontalGrids
# note: Custom Node: Revit
select_model_elements_3 = DSModelElementsSelection()  # 3 picked in the model; graph input

curve_2 = Grid.Curve(grid=select_model_elements_3)
findIntersections = Geometry.Intersection.FindIntersections(geo=curve, others=curve_2)
flatten = List.Flatten(list=findIntersections)
name = Element.Name(element=select_model_elements_2)
name_2 = Element.Name(element=select_model_elements_3)

# group: create grid intersection points
python_script = Python(IN[0]=flatten, IN[1]=name, IN[2]=name_2)
# ---------- python_script.python (27 lines) ----------
import clr

#The inputs to this node will be stored as a list in the IN variables.
class GridPoint():
	def __init__(self):
		self.Point = None
		self.Name = None
		self.vGrid = None
		self.hGrid = None
		pass

gridObjects= []

for vGrid in IN[1]:
	for hGrid in IN[2]:
		instance = GridPoint()
		instance.Name = vGrid+hGrid
		instance.vGrid = vGrid
		instance.hGrid = hGrid
		gridObjects.append(instance)

for g,p in zip(gridObjects, IN[0]):
	g.Point = p


#Assign your output to the OUT variable.
OUT = gridObjects
# ----------------------------------------

location = StructuralFraming.Location(structuralFraming=select_model_elements)
endPoints = Geometry.Curves.EndPoints(curve=location)

# group: get the point xyz
python_script_2 = Python(IN[0]=python_script)
# ---------- python_script_2.python (12 lines) ----------
import clr
clr.AddReference('ProtoGeometry')
from Autodesk.DesignScript.Geometry import *
#The inputs to this node will be stored as a list in the IN variables.

list = []

for l in IN[0]:
	subout = l.Point
	list.append(subout)
	
OUT = list
# ----------------------------------------

# group: Closest Grid point to Beam Start Point
code_block_2 = CodeBlock(a=endPoints.StartPoint) { a; }
distanceTo = Geometry.DistanceTo(geometry=code_block_2, other=python_script_2, lacing=CrossProduct)
minimumItem = List.MinimumItem(list=distanceTo, lacing=Longest)
allIndicesOf = List.AllIndicesOf(list=distanceTo, item=minimumItem, lacing=Longest)
getItemAtIndex = List.GetItemAtIndex(list=python_script, index=allIndicesOf)
flatten_2 = List.Flatten(list=getItemAtIndex)
python_script_3 = Python(IN[0]=flatten_2)
# ---------- python_script_3.python (12 lines) ----------
import clr
clr.AddReference('ProtoGeometry')
from Autodesk.DesignScript.Geometry import *
#The inputs to this node will be stored as a list in the IN variables.

list = []

for l in IN[0]:
	subout = l.Name
	list.append(subout)
	
OUT = list
# ----------------------------------------

# group: Closest Grid point to Beam End Point
code_block_3 = CodeBlock(a=endPoints.EndPoint) { a; }
distanceTo_2 = Geometry.DistanceTo(geometry=code_block_3, other=python_script_2, lacing=CrossProduct)
minimumItem_2 = List.MinimumItem(list=distanceTo_2, lacing=Longest)
allIndicesOf_2 = List.AllIndicesOf(list=distanceTo_2, item=minimumItem_2, lacing=Longest)
getItemAtIndex_2 = List.GetItemAtIndex(list=python_script, index=allIndicesOf_2)
flatten_3 = List.Flatten(list=getItemAtIndex_2)
python_script_4 = Python(IN[0]=flatten_3)  # same code as python_script_3

python_script_5 = Python(IN[0]=flatten_2, IN[1]=flatten_3)
# ---------- python_script_5.python (21 lines) ----------
import clr

startPtGrids = IN[0]
endPtGrids = IN[1]

newList = []

for s,e in zip(startPtGrids,endPtGrids):
	if s.Name == e.Name:
		newList.append(s.hGrid)
	elif s.vGrid == e.vGrid:
		newList.append(s.vGrid)
	elif s.hGrid == e.hGrid:
		newList.append(s.hGrid)
	else:
		newList.append(s.hGrid) 
		#the beam is not parallel to a grid! The offset is wrong
 


OUT = newList
# ----------------------------------------

# group: parallel grid names
flatten_4 = List.Flatten(list=python_script_5)

# group: grid lines
join = List.Join(list0=curve, list1=curve_2)

# group: grid names
join_2 = List.Join(list0=name, list1=name_2)

allIndicesOf_3 = List.AllIndicesOf(list=join_2, item=flatten_4)

# group: grid line
getItemAtIndex_3 = List.GetItemAtIndex(list=join, index=allIndicesOf_3)

flatten_5 = List.Flatten(list=getItemAtIndex_3)
code_block_4 = CodeBlock { 0.5; }
pointAtParameter = Curve.PointAtParameter(curve=location, param=code_block_4)

# group: Project Point to Grid lines plane (z=0)
XY = Plane.XY()
ZAxis = Vector.ZAxis()
reverse = Vector.Reverse(vector=ZAxis)
project = Point.Project(point=pointAtParameter, baseGeometry=XY, projectionDirection=reverse)

flatten_6 = List.Flatten(list=project)
distanceTo_3 = Geometry.DistanceTo(geometry=flatten_5, other=flatten_6)
round = Math.Round(number=distanceTo_3)
python_script_6 = Python(IN[0]=round)
# ---------- python_script_6.python (5 lines) ----------
import clr


#Assign your output to the OUT variable.
OUT = [int(n) for n in IN[0]]
# ----------------------------------------
ZAxis_2 = Vector.ZAxis()

# group: vector perpendicular to line
direction = Line.Direction(line=flatten_5)
cross = Vector.Cross(vector=direction, cross=ZAxis_2)

python_script_7 = Python(IN[0]=python_script_6, IN[1]=flatten_5, IN[2]=flatten_6, IN[3]=cross)
# ---------- python_script_7.python (24 lines) ----------
import clr
clr.AddReference('ProtoGeometry')
from Autodesk.DesignScript.Geometry import *
#The inputs to this node will be stored as a list in the IN variables.

distances = IN[0]
gridLines = IN[1]
points = IN[2]
vectors = IN[3]

result = []

for i in range(0,len(distances)):
	if distances[i]>0:
		check = points[i].Project(gridLines[i],vectors[i])
		if not check:
			result.append(distances[i]*-1)
		else:
			result.append(distances[i]*1)
	else:
		result.append(distances[i])

#Assign your output to the OUT variable.
OUT = result
# ----------------------------------------
python_script_8 = Python(IN[0]=python_script_7)
# ---------- python_script_8.python (15 lines) ----------
import clr
clr.AddReference('ProtoGeometry')
from Autodesk.DesignScript.Geometry import *
#The inputs to this node will be stored as a list in the IN variables.

newList = []
for r in IN[0]:
	if r >0:
		newList.append("+"+str(r))
	else:
		newList.append(str(r))
	

#Assign your output to the OUT variable.
OUT = newList
# ----------------------------------------
python_script_9 = Python(IN[0]=flatten_2, IN[1]=flatten_3)
# ---------- python_script_9.python (21 lines) ----------
import clr

startPtGrids = IN[0]
endPtGrids = IN[1]

newList = []

for s,e in zip(startPtGrids,endPtGrids):
	if s.Name == e.Name:
		newList.append(e.hGrid+"-"+e.vGrid)
	elif s.vGrid == e.vGrid:
		newList.append(e.hGrid+"-"+s.hGrid)
	elif s.hGrid == e.hGrid:
		newList.append(e.vGrid+"-"+s.vGrid)
	else:
		newList.append(e.Name+"-"+s.Name) 
		#the beam is not parallel to a grid! The offset is wrong
 


OUT = newList
# ----------------------------------------
code_block_5 = CodeBlock(a=flatten_4, b=python_script_8, c=python_script_9) { a+b+"/"+c; }
setParameterByName = Element.SetParameterByName(element=select_model_elements, parameterName=code_block, value=code_block_5)
code_block_6 = CodeBlock(a=python_script_4, b=python_script_3) { a+"-"+b; }

# group: perpendicular grids (2)
code_block_7 = CodeBlock { ""; }
replace = String.Replace(str=code_block_6, searchFor=flatten_4, replaceWith=code_block_7)

python_script_10 = Python(IN[0]=select_model_elements_2)
# ---------- python_script_10.python (34 lines) ----------
import clr

clr.AddReference('RevitAPI')
from Autodesk.Revit.DB import *
from Autodesk.Revit.DB.Structure import *

clr.AddReference('RevitAPIUI')
from Autodesk.Revit.UI import *

clr.AddReference('System')
from System.Collections.Generic import List

clr.AddReference('RevitNodes')
import Revit
clr.ImportExtensions(Revit.GeometryConversion)
clr.ImportExtensions(Revit.Elements)

clr.AddReference('RevitServices')
import RevitServices
from RevitServices.Persistence import DocumentManager
from RevitServices.Transactions import TransactionManager

doc = DocumentManager.Instance.CurrentDBDocument
uidoc=DocumentManager.Instance.CurrentUIApplication.ActiveUIDocument

#Preparing input from dynamo to revit
element = UnwrapElement(IN[0])

#Do some action in a Transaction
TransactionManager.Instance.EnsureInTransaction(doc)

TransactionManager.Instance.TransactionTaskDone()

OUT = [g.Curve.ToProtoType() for g in element]
# ----------------------------------------
