# Dynamo graph collectElements - Copy.dyn (Dynamo 0.8.2.2392)

code_block = CodeBlock { {"Tag","View","ViewFamilyType","Level","Site","Dimension","Matchline","Region","Clouds","Cameras", "Legend","Lines","Analy","Elevation","Text","Sheet","Spot","Grid","Section","Material"}; }
python_script = Python(IN[0]=code_block)
# ---------- python_script.python (68 lines) ----------
import clr
# Import RevitAPI
clr.AddReference("RevitAPI")
from Autodesk.Revit.DB import *
clr.AddReference("RevitAPIUI")
from Autodesk.Revit.UI import TaskDialog
# Import DocumentManager and TransactionManager
clr.AddReference("RevitServices")
from RevitServices.Persistence import DocumentManager
from RevitServices.Transactions import TransactionManager
# Import ToProtoType, ToRevitType geometry conversion extension methods
clr.AddReference("RevitNodes")
import Revit
clr.ImportExtensions(Revit.Elements)
clr.ImportExtensions(Revit.GeometryConversion)
from System.Collections.Generic import *
import System

doc = DocumentManager.Instance.CurrentDBDocument
uiapp = DocumentManager.Instance.CurrentUIApplication
app = uiapp.Application

categories = doc.Settings.Categories;

bics = System.Enum.GetValues(BuiltInCategory)

exclude = IN[0]


model_cat = []

builtInCats = List[BuiltInCategory]()


for c in categories:
	if any(e in c.Name for e in exclude):
		"skip"
	else:
		name = (c.Name).replace(' ','')
		model_cat.append("OST_"+name)

for b in bics:
	if b.ToString() in model_cat:
		builtInCats.Add(b)


filter1 = ElementMulticategoryFilter(builtInCats)

elements = FilteredElementCollector(doc).WherePasses(filter1).ToElements() 

id = [ e.GetTypeId() for e in elements]

uniqueTypesIds = list(set(id))

type = []

for i in uniqueTypesIds:
	try:
		eleType = doc.GetElement( i )
		if eleType != None:
			type.append(eleType)
	except:
		continue



#OUT = model_cat, [c.Name for c in model_cat], elements
OUT  = type, model_cat, builtInCats
# ----------------------------------------
code_block_2 = CodeBlock(a=python_script) { a[0]; }
code_block_3 = CodeBlock { "1F4"; }
code_block_4 = CodeBlock { "1F4_Discipline"; }
python_script_2 = Python(IN[0]=code_block_2, IN[1]=code_block_3, IN[2]=code_block_4)
# ---------- python_script_2.python (52 lines) ----------
import clr
# Import RevitAPI
clr.AddReference("RevitAPI")
from Autodesk.Revit.DB import *
clr.AddReference("RevitAPIUI")
from Autodesk.Revit.UI import TaskDialog
# Import DocumentManager and TransactionManager
clr.AddReference("RevitServices")
from RevitServices.Persistence import DocumentManager
from RevitServices.Transactions import TransactionManager
# Import ToProtoType, ToRevitType geometry conversion extension methods
clr.AddReference("RevitNodes")
import Revit
clr.ImportExtensions(Revit.Elements)
clr.ImportExtensions(Revit.GeometryConversion)
from System.Collections.Generic import *
import System

doc = DocumentManager.Instance.CurrentDBDocument
uiapp = DocumentManager.Instance.CurrentUIApplication
app = uiapp.Application



types = UnwrapElement(IN[0])

locCode = IN[1]
disCode = IN[2]

model_cat = []
error = []

count = 0

TransactionManager.Instance.EnsureInTransaction(doc)


for t in types:
	try:
		locationCode = t.get_Parameter("Location Code")
		locationCode.Set(locCode)
		discipline = t.get_Parameter("Discipline")
		discipline.Set(disCode)
		count +=1
	except:
		error.append(t)

TransactionManager.Instance.TransactionTaskDone()


#OUT = model_cat, [c.Name for c in model_cat], elements
OUT  = str(count)+"/"+str(len(types))+" modified", error
# ----------------------------------------
