# Dynamo graph createFilters.dyn (Dynamo 1.3.1.1736)

current = Document.Current()
activeView = Document.ActiveView(current)
resetOverridesInView = Custom[Element.ResetOverridesInView](view=activeView)  # Resets all overrides for an element in a given view; unwired: element
all_elements_in_active_view = ElementsInView()
current_2 = Document.Current()
activeView_2 = Document.ActiveView(current_2)
code_block = CodeBlock { "Weeks before actual"; }
code_block_2 = CodeBlock { "Actual Week"; }
code_block_3 = CodeBlock { "Future Works"; }
create = List.Create(code_block, code_block_2, code_block_3)
all_elements_in_active_view_2 = ElementsInView()
name = Category.Name(all_elements_in_active_view_2)
code_block_4 = CodeBlock { ""; }
code_block_5 = CodeBlock(a=name, b=code_block_4) { a==b; }
filterByBoolMask = List.FilterByBoolMask(list=all_elements_in_active_view_2, mask=code_block_5)
getCategory = Element.GetCategory(filterByBoolMask.out)
select_rule_type = RuleTypes("Less")
select_rule_type_2 = RuleTypes("Equals")
select_rule_type_3 = RuleTypes("Greater")
code_block_6 = CodeBlock(a=select_rule_type, b=select_rule_type_2, c=select_rule_type_3) { {{a},{b},{c}}; }

# group: Actual Week
code_block_7 = CodeBlock { "3"; }

code_block_8 = CodeBlock { "Comments"; }
parameterByName = Parameter.ParameterByName(element=filterByBoolMask.out, name=code_block_8)
code_block_9 = CodeBlock(a=parameterByName) { a[0]; }
byRuleType = Revit.Filter.FilterRule.ByRuleType(code_block_6, code_block_7, code_block_9, lacing=Longest)
byRules = Revit.Filter.ParameterFilterElement.ByRules(create, getCategory, byRuleType)
addFilter = View.AddFilter(activeView_2, byRules)
green = Custom[Color.Green]()  # Returns the colour green.
red = Custom[Color.Red]()  # Returns the colour red.
blue = Custom[Color.Blue]()  # Returns the colour blue.
code_block_10 = CodeBlock(a=green, b=red, c=blue) { {a,b,c}; }
fill_patterns = FillPatterns("Solid fill")
code_block_11 = CodeBlock { {0,0,50}; }
byProperties = Revit.Filter.OverrideGraphicSettings.ByProperties(arg1=code_block_10, arg5=fill_patterns, arg10=code_block_11)

# group: Shoe/Hide filters
code_block_12 = CodeBlock { {true, true, true}; }

setFilterOverrides = View.SetFilterOverrides(view=addFilter, parameterFilter=byRules, overrides=byProperties, hide=code_block_12)
code_block_13 = CodeBlock(a=setFilterOverrides) { a[0]; }
passthrough = Custom[Passthrough](passThrough=code_block_13, waitFor=setFilterOverrides)  # Forces a sequential order of execution. The node wired into the output of the Passthrough node will be executed *after* the node wired into the waitFor input (e.g. important for some Revit operations). The value of the passThrough input will be passed on to the node wired into the output port of the Passthrough node.
string = StringInput("C:\Users\giovanni.brogiolo\Documents\gwc\")
code_block_14 = CodeBlock(a=string, b=code_block_7) { a+b+".jpg"; }
exportAsImage = View.ExportAsImage(passthrough, code_block_14)
code_block_15 = CodeBlock { 1..100; }
string_from_object = FromObject(code_block_15)
boolean = BoolSelector(false)
code_block_16 = CodeBlock { 1; }
step = Core.Counter.Step(boolean, code_block_16)
count = Core.Counter.Count(step)
getItemAtIndex = List.GetItemAtIndex(list=string_from_object, index=count)
