# Dynamo graph createObject01.dyn (Dynamo 1.3.2.2480)

select_model_elements = DSModelElementsSelection()  # 21 picked in the model
code_block = CodeBlock { "Base Constraint"; }
getParameterValueByName = Element.GetParameterValueByName(element=select_model_elements, parameterName=code_block)
elevation = Level.Elevation()  # unwired: arg0
sortByFunction = SortByFunction(getParameterValueByName, elevation)
allIndicesOf = List.AllIndicesOf(list=getParameterValueByName, item=sortByFunction)
getItemAtIndex = List.GetItemAtIndex(list=select_model_elements, index=allIndicesOf)
code_block_2 = CodeBlock { "Wall Horizontal Reinforcement"; }
setParameterByName = Element.SetParameterByName(element=getItemAtIndex, parameterName=code_block_2)  # unwired: value
code_block_3 = CodeBlock { "Wall Concrete Grade"; }
code_block_4 = CodeBlock { "Wall Vertical Reinforcement"; }
code_block_5 = CodeBlock()
# ---------- code_block_5.designscript (21 lines) ----------
{"S50",
"S50",
"S50",
"S50",
"S50",
"S50",
"S50",
"S50",
"S50",
"S50",
"S50",
"S50",
"S50",
"S40",
"S40",
"S40",
"S40",
"S40",
"S40",
"S40",
"S40"};
# ----------------------------------------
code_block_6 = CodeBlock { "Wall Identification"; }
getParameterValueByName_2 = Element.GetParameterValueByName(element=getItemAtIndex, parameterName=code_block_6)
