# Dynamo graph dimensionFaces.dyn (Dynamo 1.3.2.2480)

# group: Select beams
select_model_elements = DSModelElementsSelection()  # 4 picked in the model

faces = Topology.Faces(select_model_elements)
filterByOrientation = Custom[Surface.FilterByOrientation](surfaces=faces)  # Sorts surfaces in three lists based on their orientation (vertical, horizontal up & horizontal down) and also returns three corresponding lists of booleans.
normalAtParameter = Surface.NormalAtParameter(surface=filterByOrientation.vertical)

# group: Swap if beams are horizontal or verticals
YAxis = Vector.YAxis()
XAxis = Vector.XAxis()

isParallel = Vector.IsParallel(normalAtParameter, YAxis)
filterByBoolMask = List.FilterByBoolMask(list=filterByOrientation.vertical, mask=isParallel)
code_block = CodeBlock { {0,1}; }
getItemAtIndex = List.GetItemAtIndex(list=filterByBoolMask.in@L2, index=code_block)
flatten = Flatten(getItemAtIndex)
fromDynamoSurface = Custom[RevitFaceReference.FromDynamoSurface](DynamoSurface=flatten)  # Returns the underlying Revit face reference of a given surface
area = Surface.Area(filterByBoolMask.in)
ZAxis = Vector.ZAxis()

# group: Select Line
select_model_elements_2 = DSModelElementsSelection()  # 1 picked in the model

python_script = Python(IN[0]=flatten)
# ---------- python_script.python (13 lines) ----------
import clr
clr.AddReference('RevitAPI')
from Autodesk.Revit.DB import *

faces = UnwrapElement(IN[0])
elementlist = list()
for face in faces:
	try:
		ref = face.Tags.LookupTag("RevitFaceReference")
		elementlist.append(ref)
	except:
		elementlist.append(list())
OUT = elementlist
# ----------------------------------------
python_script_2 = Python(IN[0]=select_model_elements_2, IN[1]=python_script)
# ---------- python_script_2.python (40 lines) ----------
import clr
clr.AddReference('ProtoGeometry')
from Autodesk.DesignScript.Geometry import *

clr.AddReference("RevitNodes")
import Revit

from Revit.Elements import *

clr.AddReference('RevitAPI')
from Autodesk.Revit.DB import *

clr.AddReference("RevitServices")
import RevitServices
from RevitServices.Persistence import DocumentManager
from RevitServices.Transactions import TransactionManager

dataEnteringNode = IN

doc = DocumentManager.Instance.CurrentDBDocument

line = UnwrapElement(IN[0]).GeometryCurve
elements=(IN[1])
dim = 0

elementsRef = ReferenceArray()
opt=Options()
opt.ComputeReferences=True
opt.IncludeNonVisibleObjects=True
opt.View=doc.ActiveView
for element in elements:
	elementsRef.Append(element)
TransactionManager.Instance.EnsureInTransaction(doc)

dim=doc.Create.NewDimension(doc.ActiveView, line, elementsRef)
(True)

TransactionManager.Instance.TransactionTaskDone()

OUT = dim
# ----------------------------------------
