# Dynamo graph docChange.dyn (Dynamo 2.0.1.5055)

python_script = Python()  # unwired: IN[0]
# ---------- python_script.python (36 lines) ----------
import clr

clr.AddReference("System")
from System import EventHandler

clr.AddReference("RevitAPIUI")
from Autodesk.Revit.UI import IExternalEventHandler, ExternalEvent, TaskDialog

clr.AddReference("RevitAPI")
from Autodesk.Revit.DB import *

from Autodesk.Revit.Exceptions import InvalidOperationException

clr.AddReference('RevitServices')
from RevitServices.Persistence import DocumentManager

uiapp = DocumentManager.Instance.CurrentUIApplication
app = uiapp.Application
doc = DocumentManager.Instance.CurrentDBDocument
uidoc = DocumentManager.Instance.CurrentUIApplication.ActiveUIDocument

def docChange(sender, args):
	TaskDialog.Show("Result", "Doc Changed")

try:
    uiapp.Application.DocumentChanged += docChange
except(ex):        
    TaskDialog.Show("ERROR", ex.ToString())
finally:
	uiapp.Application.DocumentChanged -= docChange
        	




OUT = 0
# ----------------------------------------
