# Dynamo graph docChange01.dyn (Dynamo 1.3.3.4651)

python_script = Python()  # unwired: IN[0]
# ---------- python_script.python (39 lines) ----------
import clr

clr.AddReference("System")
from System import EventHandler

clr.AddReference("RevitAPIUI")
from Autodesk.Revit.UI import IExternalEventHandler, ExternalEvent, TaskDialog

clr.AddReference("RevitAPI")
from Autodesk.Revit.DB import *

from Autodesk.Revit.Exceptions import InvalidOperationException

clr.AddReference('RevitServices')
from RevitServices.Persistence import DocumentManager

uiapp = DocumentManager.Instance.CurrentUIApplication
app = uiapp.Application
doc = DocumentManager.Instance.CurrentDBDocument
uidoc = DocumentManager.Instance.CurrentUIApplication.ActiveUIDocument

def docChange(sender, args):
	TaskDialog.Show("Result", "Doc Changed")


doc.Application.DocumentChanged += docChange

try:
    TaskDialog.Show("Title", "Subscribed")
except(ex):        
    TaskDialog.Show("ERROR", ex.ToString())
finally:
	doc.Application.DocumentChanged -= docChange
	TaskDialog.Show("Title", "Un-Subscribed")    	




OUT = 0
# ----------------------------------------
