# Dynamo graph documentPBSP1.dyn (Dynamo 1.3.3.4651)

file_path = Filename("\\global.arup.com\australasia\MEL\Projects\261000\261184-00 Shipwreck Coast Master\Work\Internal\BIM_CDE\01_WORKING\10_STR\00_MODEL\261184-ARP-M3-S_R18-ASL.rvt")
file_path_2 = Filename("\\global.arup.com\australasia\MEL\Projects\261000\261184-00 Shipwreck Coast Master\Work\Internal\BIM_CDE\01_WORKING\10_STR\00_MODEL\261184-ARP-M3-S_R18-LAB.rvt")

# group: Folder file path
string = StringInput("\\global.arup.com\australasia\MEL\Projects\261000\261184-00 Shipwreck Coast Master\Record Copy\Outgoing\2018-08-03 80%DD Issue (Structural, Civil, Lighting)\Structural\Revit models")

fromPath = DirectoryObject(string)  # "Directory.FromPath"
contents = Directory.Contents(fromPath)

# group: choose how many model to open i.e. n. of models = 30 0..10 ->run ->close files true->run 11..20 ->run ->close files true->run 21..30 ->run ->close files true->run
code_block = CodeBlock { 0..2; }
getItemAtIndex = List.GetItemAtIndex(list=contents, index=code_block)

open_documents = Python(IN[0]=getItemAtIndex)
# ---------- open_documents.python (37 lines) ----------
import clr
clr.AddReference('ProtoGeometry')
from Autodesk.DesignScript.Geometry import *

# Import Element wrapper extension methods
clr.AddReference("RevitNodes")
import Revit
clr.ImportExtensions(Revit.Elements)

# Import geometry conversion extension methods
clr.ImportExtensions(Revit.GeometryConversion)

# Import DocumentManager and TransactionManager
clr.AddReference("RevitServices")
import RevitServices
from RevitServices.Persistence import DocumentManager
from RevitServices.Transactions import TransactionManager

doc = DocumentManager.Instance.CurrentDBDocument
uiapp = DocumentManager.Instance.CurrentUIApplication
app = uiapp.Application

# Import RevitAPI
clr.AddReference("RevitAPI")
import Autodesk
from Autodesk.Revit.DB import *

items = IN[0]

typelist = list()
for i in items:
	try:
		typelist.append(app.OpenDocumentFile(i))
	except:
		typelist.append(list())
		
OUT = typelist
# ----------------------------------------

# group: base points
python_script = Python(IN[0]=open_documents)
# ---------- python_script.python (37 lines) ----------
#Copyright(c) 2017, john pierson
# @60secondrevit, http://sixtysecondrevit.com
import clr
clr.AddReference('ProtoGeometry')
from Autodesk.DesignScript.Geometry import *

# Import Element wrapper extension methods
clr.AddReference("RevitNodes")
import Revit
clr.ImportExtensions(Revit.Elements)

# Import geometry conversion extension methods
clr.ImportExtensions(Revit.GeometryConversion)

# Import DocumentManager and TransactionManager
clr.AddReference("RevitServices")
import RevitServices
from RevitServices.Persistence import DocumentManager
from RevitServices.Transactions import TransactionManager

doc = DocumentManager.Instance.CurrentDBDocument
uiapp = DocumentManager.Instance.CurrentUIApplication
app = uiapp.Application

# Import RevitAPI
clr.AddReference("RevitAPI")
import Autodesk
from Autodesk.Revit.DB import *

doc = IN[0]

collector = []

for d in doc:
	collector.append(FilteredElementCollector(d).OfCategory(BuiltInCategory.OST_ProjectBasePoint).ToElements()[0])
		
OUT = collector
# ----------------------------------------

parameters = Element.Parameters(python_script)

# group: CLOSE THE FILES!
save = BoolSelector(false)
close_files = Python(IN[0]=open_documents, IN[1]=save)  # frozen
# ---------- close_files.python (39 lines) ----------
#Created by john pierson for dynamo
#sixtysecondrevit.blogspot.com
import clr
clr.AddReference('ProtoGeometry')
from Autodesk.DesignScript.Geometry import *

# Import Element wrapper extension methods
clr.AddReference("RevitNodes")
import Revit
clr.ImportExtensions(Revit.Elements)

# Import geometry conversion extension methods
clr.ImportExtensions(Revit.GeometryConversion)

# Import DocumentManager and TransactionManager
clr.AddReference("RevitServices")
import RevitServices
from RevitServices.Persistence import DocumentManager
from RevitServices.Transactions import TransactionManager

doc = DocumentManager.Instance.CurrentDBDocument
uiapp = DocumentManager.Instance.CurrentUIApplication
app = uiapp.Application

# Import RevitAPI
clr.AddReference("RevitAPI")
import Autodesk
from Autodesk.Revit.DB import *

items = IN[0]

typelist = list()
for i in items:
	try:
		typelist.append(i.Close(IN[1]))
	except:
		typelist.append(list())
		
OUT = typelist
# ----------------------------------------

# group: survey points
python_script_2 = Python(IN[0]=open_documents)
# ---------- python_script_2.python (37 lines) ----------
#Copyright(c) 2017, john pierson
# @60secondrevit, http://sixtysecondrevit.com
import clr
clr.AddReference('ProtoGeometry')
from Autodesk.DesignScript.Geometry import *

# Import Element wrapper extension methods
clr.AddReference("RevitNodes")
import Revit
clr.ImportExtensions(Revit.Elements)

# Import geometry conversion extension methods
clr.ImportExtensions(Revit.GeometryConversion)

# Import DocumentManager and TransactionManager
clr.AddReference("RevitServices")
import RevitServices
from RevitServices.Persistence import DocumentManager
from RevitServices.Transactions import TransactionManager

doc = DocumentManager.Instance.CurrentDBDocument
uiapp = DocumentManager.Instance.CurrentUIApplication
app = uiapp.Application

# Import RevitAPI
clr.AddReference("RevitAPI")
import Autodesk
from Autodesk.Revit.DB import *

doc = IN[0]

collector = []

for d in doc:
	collector.append(FilteredElementCollector(d).OfCategory(BuiltInCategory.OST_SharedBasePoint).ToElements()[0])
		
OUT = collector
# ----------------------------------------

parameters_2 = Element.Parameters(python_script_2)

# group: Pick Excel File
file_path_3 = Filename("..\Desktop\output.xlsx")

# group: After the first run update the Excel Row to avoid override the values!
code_block_2 = CodeBlock { 2; }

code_block_3 = CodeBlock { {"E/W","N/S", "Angle to True North"}; }

# group: number of digits
code_block_4 = CodeBlock { 15; }

python_script_3 = Python(IN[0]=python_script, IN[1]=code_block_3, IN[2]=code_block_4)
# ---------- python_script_3.python (43 lines) ----------
import clr
clr.AddReference('ProtoGeometry')
from Autodesk.DesignScript.Geometry import *

# Import DocumentManager and TransactionManager
clr.AddReference("RevitServices")
import RevitServices
from RevitServices.Persistence import DocumentManager
from RevitServices.Transactions import TransactionManager

# Import RevitAPI
clr.AddReference("RevitAPI")
import Autodesk
from Autodesk.Revit.DB import *


ele = UnwrapElement(IN[0])
name = IN[1]
precision = '{0:.'+str(IN[2])+'}'

def GetParam(element, paramName):
	value = []
	for p in element.Parameters:
		if p.Definition.Name == paramName:
			ProjectUnits = p.DisplayUnitType
			newVal = UnitUtils.ConvertFromInternalUnits(p.AsDouble(),ProjectUnits)
			value.append(precision.format(newVal))
	return value

result = []

for e in ele:
	sub = []
	result.append(sub)
	for n in name:
		if GetParam(e,n):
			sub.append(GetParam(e,n)[0])
		else:
			sub.append("N/A")



OUT = result
# ----------------------------------------

# group: number of digits
code_block_5 = CodeBlock { 15; }

python_script_4 = Python(IN[0]=python_script_2, IN[1]=code_block_3, IN[2]=code_block_5)  # same code as python_script_3

# group: Write to Excel
code_block_6 = CodeBlock { "Output"; }
code_block_7 = CodeBlock { false; }
writeToFile = Excel.WriteToFile(filePath=file_path_3, sheetName=code_block_6, startRow=code_block_2, overWrite=code_block_7)  # unwired: startCol, data
code_block_8 = CodeBlock { {0,1,4}; }
code_block_9 = CodeBlock(Model=getItemAtIndex, PBP=python_script_3, SP=python_script_4) { {Model,PBP,SP}; }
combine = List.Combine(writeToFile, code_block_8, code_block_9)
code_block_10 = CodeBlock { {"PBP","PBP","PBP"}; }
addItemToFront = List.AddItemToFront(item=code_block_3, list=python_script_3)
addItemToFront_2 = List.AddItemToFront(item=code_block_10, list=addItemToFront)
code_block_11 = CodeBlock { {"SP","SP","SP"}; }
addItemToFront_3 = List.AddItemToFront(item=code_block_3, list=python_script_4)
addItemToFront_4 = List.AddItemToFront(item=code_block_11, list=addItemToFront_3)
code_block_12 = CodeBlock { {"Model"}; }
code_block_13 = CodeBlock { {"Name"}; }
addItemToFront_5 = List.AddItemToFront(item=code_block_13, list=getItemAtIndex)
addItemToFront_6 = List.AddItemToFront(item=code_block_12, list=addItemToFront_5)
