# Dynamo graph dynamoBurst.dyn (Dynamo 1.3.2.2480)

# group: DESIGN
# note: DESIGN
# note: USE:
# FOR THE BACK-END FUNCTIONALITY

# group: MONITOR
# note: MONITOR
# note: USE:
# FOR IMPORTANT WATCH NODES

# group: CONTROL
# note: CONTROL
# note: USE:
# USER DEFINED INPUTS SUCH A NUMBER
# SLIDERS, STRINGS, KNOWN FILE PATHS
# ETC.

# group: ANNOTATION
# note: ANNOTATION
# note: USE:
# FOR COMMENTS

# group: UNUSED
# note: UNUSED
# note: USE:
# UNUSED

# group: UNUSED
# note: UNUSED
# note: USE:
# UNUSED

# group: INPUT
# note: INPUT
# note: USE:
# FOR INCOMING REFERENCES, WHICH ARE
# NOT USER DEFINED, SUCH AS FILE PATHS,
# GEOMETRIES, POINTS ETC.

# group: WIP
# note: WIP
# note: USE:
# FOR "WORK IN PROGRESS"

# group: UNUSED
# note: UNUSED
# note: USE:
# UNUSED

# group: TO REVIT
# note: TO REVIT
# note: USE:
# FOR BLOCKS WHICH EXPORT INFORMATION
# TO REVIT

# group: TO SOFTWARE
# note: TO SOFTWARE
# note: USE:
# FOR BLOCKS WHICH EXPORT INFORMATION
# TO SOFTWARE OTHER THAN REVIT

# group: UNUSED
# note: UNUSED
# note: USE:
# UNUSED

code_block = CodeBlock { 10; }
code_block_2 = CodeBlock { Autodesk.Point.ByCoordinates(0,0,0); }
code_block_3 = CodeBlock { 5000; }
byCenterPointRadius = Circle.ByCenterPointRadius(centerPoint=code_block_2, radius=code_block_3)
code_block_4 = CodeBlock { 15; }
divideCurve = Geometry.Curves.DivideCurve(byCenterPointRadius, code_block_4)
code_block_5 = CodeBlock { 8000; }
translate = Geometry.Translate(geometry=byCenterPointRadius, zTranslation=code_block_5)
XY = Plane.XY()
number_slider = DoubleSlider(100, range=0..360 step 5)
rotate = Geometry.Rotate(translate, XY, number_slider)
divideCurve_2 = Geometry.Curves.DivideCurve(rotate, code_block_4)
byStartPointEndPoint = Line.ByStartPointEndPoint(startPoint=divideCurve.out0, endPoint=divideCurve_2)
levels = Levels("00")
structural_framing_types = StructuralFramingTypes("UKA150x150x10")
beamByCurve = StructuralFraming.BeamByCurve(curve=byStartPointEndPoint, level=levels, structuralFramingType=structural_framing_types)  # frozen
code_block_6 = CodeBlock { "Mark"; }
string_from_object = FromObject(divideCurve.out3)
setParameterByName = Element.SetParameterByName(element=beamByCurve, parameterName=code_block_6, value=string_from_object)
count = Count(beamByCurve)
code_block_7 = CodeBlock(count=count) { 0..1..#count; }
color_range = ColorRange(arg2=code_block_7)  # unwired: arg0, arg1
overrideColorInView = Element.OverrideColorInView(element=beamByCurve, color=color_range)
file_path = Filename("..\Desktop\DynamoBurst\pointCoords.xlsx")  # frozen
fromPath = FileObject(file_path)  # "File.FromPath"
code_block_8 = CodeBlock { "Sheet1"; }
readFromFile = Excel.ReadFromFile(file=fromPath, sheetName=code_block_8)
python_script = Python(IN[0]=readFromFile)
# ---------- python_script.python (24 lines) ----------
import clr
clr.AddReference('ProtoGeometry')
from Autodesk.DesignScript.Geometry import *
#The inputs to this node will be stored as a list in the IN variables.


points = IN[0]

dynamoPoints = []

def splitPts(point):
	pt = point.split(',')
	return Point.ByCoordinates(float(pt[0]),float(pt[1]),float(pt[2]))


for pts in points:
	subList = []
	dynamoPoints.append(subList)
	for p in pts:
		subList.append(splitPts(p))


#Assign your output to the OUT variable.
OUT = dynamoPoints
# ----------------------------------------
byPerimeterPoints = Surface.ByPerimeterPoints(python_script)
code_block_9 = CodeBlock { 0.5; }
pointAtParameter = Surface.PointAtParameter(surface=byPerimeterPoints, u=code_block_9, v=code_block_9)
normalAtParameter = Surface.NormalAtParameter(surface=byPerimeterPoints, u=code_block_9, v=code_block_9)
code_block_10 = CodeBlock { 10000; }
byStartPointDirectionLength = Line.ByStartPointDirectionLength(startPoint=pointAtParameter, direction=normalAtParameter, length=code_block_10)
family_types = FamilyTypes("ROOF-PANEL-4PT:ROOF-PANEL-4PT")
byPoints = AdaptiveComponent.ByPoints(points=python_script, familyType=family_types)
ZAxis = Vector.ZAxis()
angleWithVector = Vector.AngleWithVector(vector=ZAxis, otherVector=normalAtParameter)
code_block_11 = CodeBlock { 0; 1; }
remapRange = Math.RemapRange(numbers=angleWithVector, newMin=code_block_11.out0, newMax=code_block_11.out1)
color_range_2 = ColorRange(arg2=remapRange)  # unwired: arg0, arg1
overrideColorInView_2 = Element.OverrideColorInView(element=byPoints, color=color_range_2)
code_block_12 = CodeBlock { "Aperture Ratio"; }
code_block_13 = CodeBlock { 0.2; 0.7; }
remapRange_2 = Math.RemapRange(numbers=angleWithVector, newMin=code_block_13.out0, newMax=code_block_13.out1)
setParameterByName_2 = Element.SetParameterByName(element=overrideColorInView_2, parameterName=code_block_12, value=remapRange_2)
get_RhinoFile = Interoperability.ReadRhino.OpenRhino3dmModel.Get_RhinoFile()  # unwired: arg0
get_RhinoLayerNames = Interoperability.ReadRhino.RhinoObject.Get_RhinoLayerNames(get_RhinoFile)
code_block_14 = CodeBlock(a=get_RhinoLayerNames) { a[9]; }
get_RhinoObjectsByLayer = Interoperability.ReadRhino.RhinoObject.Get_RhinoObjectsByLayer(get_RhinoFile, code_block_14)
rhino_LinesToDS = Interoperability.ReadRhino.RhinoTranslationToDS.Rhino_LinesToDS(get_RhinoObjectsByLayer)
file_path_2 = Filename("\\global.arup.com\australasia\MEL\Projects\249000\249613-00 Carlton Connect Precinct\Work\Internal\BIM_CDE\00_WORKING\02_STRUCTURE\08_DWG\Stair\Stair 1.3dm")
rhino_AllGeometryToDS = Interoperability.ReadRhino.RhinoTranslationToDS.Rhino_AllGeometryToDS(get_RhinoObjectsByLayer)
code_block_15 = CodeBlock(a=rhino_AllGeometryToDS.out1) { a; }
rhino_CurvesToDS = Interoperability.ReadRhino.RhinoTranslationToDS.Rhino_CurvesToDS()  # unwired: arg0
byCurve = ModelCurve.ByCurve()  # unwired: arg0
code_block_16 = CodeBlock { 0; }
offset = Curve.Offset(curve=rhino_AllGeometryToDS.out1, distance=code_block_16)
levels_2 = Levels()
structural_framing_types_2 = StructuralFramingTypes()
beamByCurve_2 = StructuralFraming.BeamByCurve(curve=offset, level=levels_2, structuralFramingType=structural_framing_types_2)

# group: Select the Rhino file
file_path_3 = Filename("\\global.arup.com\australasia\MEL\Projects\249000\249613-00 Carlton Connect Precinct\Work\Internal\BIM_CDE\00_WORKING\02_STRUCTURE\08_DWG\Stair\Stair 1.3dm")  # frozen

get_RhinoFile_2 = Interoperability.ReadRhino.OpenRhino3dmModel.Get_RhinoFile(file_path_3)

# group: Get all the layers in the Rhino
get_RhinoLayerNames_2 = Interoperability.ReadRhino.RhinoObject.Get_RhinoLayerNames(get_RhinoFile_2)

# group: Select the layer to import
code_block_17 = CodeBlock(a=get_RhinoLayerNames_2) { a[9]; }

# group: Read the curves in Rhino and create Dynamo curves
get_RhinoObjectsByLayer_2 = Interoperability.ReadRhino.RhinoObject.Get_RhinoObjectsByLayer(get_RhinoFile_2, code_block_17)
rhino_AllGeometryToDS_2 = Interoperability.ReadRhino.RhinoTranslationToDS.Rhino_AllGeometryToDS(get_RhinoObjectsByLayer_2)
code_block_18 = CodeBlock { 1; }
simplify = Curve.Simplify(rhino_AllGeometryToDS_2.out1, code_block_18)

# group: Create stringers in Revit
levels_3 = Levels("00")
structural_framing_types_3 = StructuralFramingTypes("RHS200x100x10")
beamByCurve_3 = StructuralFraming.BeamByCurve(curve=simplify, level=levels_3, structuralFramingType=structural_framing_types_3)

code_block_19 = CodeBlock()
# ---------- code_block_19.designscript (18 lines) ----------
/*
NOTES

Description of script, its function
and anything additional required to
run. Should be consise

WRITTEN BY  - Author
DYNAMO VERSION - 1.2
PACKAGES  - None
REVIT TEMPLATE - AUS
LAST UPDATED - dd-mm-yyyy

FUTURE IMPROVEMENTS
- list of potential improvements
- which could be made in the future
- if developed further
*/;
# ----------------------------------------
python_script_2 = Python()  # unwired: IN[0]
# ---------- python_script_2.python (34 lines) ----------
import clr
clr.AddReference('ProtoGeometry')
from Autodesk.DesignScript.Geometry import *

# import revit API
clr.AddReference("RevitAPI")
import Autodesk
from Autodesk.Revit.DB import *
#import document manager and transacetion 
clr.AddReference("RevitServices")
import RevitServices
from RevitServices.Persistence import DocumentManager
from RevitServices.Transactions import TransactionManager
#import ToDSType bool extension method
clr.AddReference("RevitNodes")
import Revit
clr.ImportExtensions(Revit.Elements)
clr.ImportExtensions(Revit.GeometryConversion)

doc = DocumentManager.Instance.CurrentDBDocument


#The inputs to this node will be stored as a list in the IN variables.
dataEnteringNode = IN

#Create transaction
TransactionManager.Instance.EnsureInTransaction(doc)

#Put script code here


TransactionManager.Instance.TransactionTaskDone()
#Assign your output to the OUT variable.
OUT = 0
# ----------------------------------------

# group: Check errors
code_block_20 = CodeBlock(a=get_RhinoObjectsByLayer_2) { a[13]; }
get_RhinoGeometryAttributes = Interoperability.ReadRhino.RhinoObjectAttributes.Get_RhinoGeometryAttributes(code_block_20)
code_block_21 = CodeBlock { 1; }
watch = Custom[Springs.Watch+](reset=code_block_21)  # This node that serializes the input information and presents it in a resizable text window.; unwired: input

# group: Bottom Circle Center and Radius
code_block_22 = CodeBlock { Autodesk.Point.ByCoordinates(0,0,30000); }
code_block_23 = CodeBlock { 5000; }
byCenterPointRadius_2 = Circle.ByCenterPointRadius(centerPoint=code_block_22, radius=code_block_23)  # frozen

code_block_24 = CodeBlock { 15; }
divideCurve_3 = Geometry.Curves.DivideCurve(byCenterPointRadius_2, code_block_24)
code_block_25 = CodeBlock { 8000; }

# group: Top Circle
translate_2 = Geometry.Translate(geometry=byCenterPointRadius_2, zTranslation=code_block_25)

number_slider_2 = DoubleSlider(55, range=0..360 step 5)

# group: Top Circle rotation
XY_2 = Plane.XY()
rotate_2 = Geometry.Rotate(translate_2, XY_2, number_slider_2)

divideCurve_4 = Geometry.Curves.DivideCurve(rotate_2, code_block_24)
structural_framing_types_4 = StructuralFramingTypes("UKA150x150x10")

# group: Create beams in Revit
byStartPointEndPoint_2 = Line.ByStartPointEndPoint(startPoint=divideCurve_3.out0, endPoint=divideCurve_4)
levels_4 = Levels("00")
beamByCurve_4 = StructuralFraming.BeamByCurve(curve=byStartPointEndPoint_2, level=levels_4, structuralFramingType=structural_framing_types_4)

# group: Set Mark parameter
code_block_26 = CodeBlock { "Mark"; }
string_from_object_2 = FromObject(divideCurve_3.out3)
setParameterByName_3 = Element.SetParameterByName(element=beamByCurve_4, parameterName=code_block_26, value=string_from_object_2)

# group: Override beam colour
count_2 = Count(beamByCurve_4)
code_block_27 = CodeBlock(count=count_2) { 0..1..#count; }
color_range_3 = ColorRange(arg2=code_block_27)  # unwired: arg0, arg1
overrideColorInView_3 = Element.OverrideColorInView(element=beamByCurve_4, color=color_range_3)

# group: Select the Rhino file
file_path_4 = Filename("..\Desktop\DynamoBurst\Roof.3dm")  # frozen

# group: Get surface in Rhino
get_RhinoFile_3 = Interoperability.ReadRhino.OpenRhino3dmModel.Get_RhinoFile(file_path_4)
get_RhinoObjects = Interoperability.ReadRhino.RhinoObject.Get_RhinoObjects(get_RhinoFile_3)
rhino_NurbsSurfaceToDS = Interoperability.ReadRhino.RhinoTranslationToDS.Rhino_NurbsSurfaceToDS(get_RhinoObjects)

# group: Divide surface UV
code_block_28 = CodeBlock { 10; }
code_block_29 = CodeBlock { 20; }
divideSurfaceUV = Geometry.Surfaces.DivideSurfaceUV(rhino_NurbsSurfaceToDS, code_block_28, code_block_29)

# group: Create U curves
byPoints_2 = PolyCurve.ByPoints(points=divideSurfaceUV)
explode = Geometry.Explode(byPoints_2)

# group: Create V curves
code_block_30 = CodeBlock(a=divideSurfaceUV) { a[0]; }
transpose = List.Transpose(code_block_30)
byPoints_3 = PolyCurve.ByPoints(points=transpose)
explode_2 = Geometry.Explode(byPoints_3)

# group: Create model curve in Revit
byCurve_2 = ModelCurve.ByCurve(explode)
byCurve_3 = ModelCurve.ByCurve(explode_2)

# group: Select the point file
file_path_5 = Filename("..\Desktop\DynamoBurst\pointCoords.xlsx")  # frozen

# group: Select Excel Worksheet
code_block_31 = CodeBlock { "Sheet1"; }

# group: Import the coordinates
fromPath_2 = FileObject(file_path_5)  # "File.FromPath"
readFromFile_2 = Excel.ReadFromFile(file=fromPath_2, sheetName=code_block_31)

# group: Create Dynamo points
python_script_3 = Python(IN[0]=readFromFile_2)  # same code as python_script

# group: Select Revit Adaptive Family
family_types_2 = FamilyTypes("ROOF-PANEL-4PT:ROOF-PANEL-4PT")

# group: Place the Adaptive Family
byPoints_4 = AdaptiveComponent.ByPoints(points=python_script_3, familyType=family_types_2)

# group: Create panel surface, find the normal at panel center, calculate the angle with ZAxis
ZAxis_2 = Vector.ZAxis()
byPerimeterPoints_2 = Surface.ByPerimeterPoints(python_script_3)
code_block_32 = CodeBlock { 0.5; }
normalAtParameter_2 = Surface.NormalAtParameter(surface=byPerimeterPoints_2, u=code_block_32, v=code_block_32)
angleWithVector_2 = Vector.AngleWithVector(vector=ZAxis_2, otherVector=normalAtParameter_2)

# group: Create colours
code_block_33 = CodeBlock { 0; 1; }
remapRange_3 = Math.RemapRange(numbers=angleWithVector_2, newMin=code_block_33.out0, newMax=code_block_33.out1)
color_range_4 = ColorRange(arg2=remapRange_3)  # unwired: arg0, arg1

# group: Override Revit element's colour
overrideColorInView_4 = Element.OverrideColorInView(element=byPoints_4, color=color_range_4)

# group: Set the Adaptive Family aperture value
code_block_34 = CodeBlock { "Aperture Ratio"; }
code_block_35 = CodeBlock { 0.2; 0.7; }
remapRange_4 = Math.RemapRange(numbers=angleWithVector_2, newMin=code_block_35.out0, newMax=code_block_35.out1)
setParameterByName_4 = Element.SetParameterByName(element=overrideColorInView_4, parameterName=code_block_34, value=remapRange_4)

code_block_36 = CodeBlock()
# ---------- code_block_36.designscript (3 lines) ----------
/*
Create structural framings from curves
*/;
# ----------------------------------------
code_block_37 = CodeBlock()
# ---------- code_block_37.designscript (3 lines) ----------
/*
Create structural framings from Rhino curves
*/;
# ----------------------------------------
code_block_38 = CodeBlock()
# ---------- code_block_38.designscript (3 lines) ----------
/*
Create structural framings from Rhino surfaces
*/;
# ----------------------------------------
code_block_39 = CodeBlock()
# ---------- code_block_39.designscript (3 lines) ----------
/*
Place Adaptive Families from Excel points
*/;
# ----------------------------------------
openGsaFile = ReadGsa.Core.OpenGsaFile()  # unwired: arg0

# group: Extract GSA geometry
code_block_40 = CodeBlock { "all"; }
elements = ReadGsa.GSAElements.Elements(openGsaFile, code_block_40)
nodesFromRefs = ReadGsa.GSANodes.NodesFromRefs(openGsaFile, elements.out1)

# group: Extract Beam Reactions
code_block_41 = CodeBlock { "C1"; }
code_block_42 = CodeBlock { 0; }
beamAllResults = ReadGsa.Analysis.BeamAllResults(openGsaFile, code_block_41, elements.out0, code_block_42, code_block_42)

# group: Select GSA file
file_path_6 = Filename("C:\Program Files\Oasys\GSA 8.7\Samples\Steel\Steel_Design_Complex.gwb")

# group: Set displacement magnifier
integer_slider = IntegerSlider(50, range=0..100 step 1)

# group: Get Node Displacements and generate deformed geometry
nodeDisplacements = ReadGsa.Analysis.NodeDisplacements(openGsaFile, elements.out1)
code_block_43 = CodeBlock { 5; }
getItemAtIndex = List.GetItemAtIndex(list=nodeDisplacements@L2, index=code_block_43, lacing=Longest)
code_block_44 = CodeBlock { 2; }
chop = List.Chop(list=getItemAtIndex, lengths=code_block_44)
toNumber = String.ToNumber(chop)
mul = toNumber * integer_slider  # lacing=Longest
translate_3 = Geometry.Translate(geometry=nodesFromRefs.out1, zTranslation=mul)
deconstruct = List.Deconstruct(list=translate_3, lacing=Longest)
byStartPointEndPoint_3 = Line.ByStartPointEndPoint(startPoint=deconstruct.first, endPoint=deconstruct.rest)

# group: Adjust to Revit units [mm]
flatten = Flatten(byStartPointEndPoint_3)
code_block_45 = CodeBlock { 1000; }
scale = Geometry.Scale(geometry=flatten, amount=code_block_45)

# group: Create Revit curves
byCurve_4 = ModelCurve.ByCurve(scale)

code_block_46 = CodeBlock()
# ---------- code_block_46.designscript (3 lines) ----------
/*
Import GSA gemetry and reactions in Revit
*/;
# ----------------------------------------
