# Dynamo graph edgeGeometry.dyn (Dynamo 2.0.1.4955)

select_model_elements = DSModelElementsSelection()  # 1 picked in the model
python_script = Python(IN[0]=select_model_elements)
# ---------- python_script.python (49 lines) ----------
import clr

clr.AddReference('RevitAPI')
from Autodesk.Revit.DB import *
from Autodesk.Revit.DB.Structure import *

clr.AddReference('RevitAPIUI')
from Autodesk.Revit.UI import *

clr.AddReference('System')
from System.Collections.Generic import List

clr.AddReference('RevitNodes')
import Revit
clr.ImportExtensions(Revit.GeometryConversion)
clr.ImportExtensions(Revit.Elements)

clr.AddReference('RevitServices')
import RevitServices
from RevitServices.Persistence import DocumentManager
from RevitServices.Transactions import TransactionManager

doc = DocumentManager.Instance.CurrentDBDocument
uidoc=DocumentManager.Instance.CurrentUIApplication.ActiveUIDocument

#Preparing input from dynamo to revit
element = UnwrapElement(IN[0])

opt = Options()
opt.ComputeReferences = True
opt.IncludeNonVisibleObjects = False
opt.View = doc.ActiveView

edgeArray = []

for obj in element.get_Geometry(opt):
	edgeArray.append(obj.Edges)
	
styles = []
for e in edgeArray[0]:
	styles.append(e.LinePattern)


#Do some action in a Transaction
TransactionManager.Instance.EnsureInTransaction(doc)

TransactionManager.Instance.TransactionTaskDone()

OUT = edgeArray, styles
# ----------------------------------------
