# Dynamo graph editFamily.dyn (Dynamo 1.3.3.4651)

file_path = Filename("..\Documents\GioBro\Arup_Beam_Steel Asymmetric I Section.rfa")
boolean = BoolSelector(false)
python_script = Python(IN[0]=file_path, IN[1]=boolean)
# ---------- python_script.python (64 lines) ----------
import clr

clr.AddReference("RevitServices")
import RevitServices
from RevitServices.Persistence import DocumentManager
from RevitServices.Transactions import TransactionManager

clr.AddReference('RevitAPI')
clr.AddReference('RevitAPIUI')
from Autodesk.Revit.DB import *
from Autodesk.Revit.UI import *

doc = DocumentManager.Instance.CurrentDBDocument
uidoc=DocumentManager.Instance.CurrentUIApplication.ActiveUIDocument

app = DocumentManager.Instance.CurrentUIApplication.Application

filePath = IN[0]

open_file = app.OpenDocumentFile(filePath)

fm = open_file.FamilyManager

deleted = 0
error = []

y = Transaction(open_file, "Put in parameter")

y.Start()

subTr = SubTransaction(open_file)
subTr.Start()

familyTypes = fm.Types

count = familyTypes.Size

while count > 1:
	fm.DeleteCurrentType()
	count -=1

try:
	fm.RenameCurrentType("Default")
except:
	error.append("Default Type already present")

#run the purge command

familyApp = open_file.Application;
uiapp = UIApplication( familyApp )


pCmd = RevitCommandId.LookupPostableCommandId(PostableCommand.PurgeUnused)
uiapp.PostCommand(pCmd)



subTr.Commit()

y.Commit()

open_file.Close()

OUT = count
# ----------------------------------------
