# Dynamo graph electricalDemandFactor.dyn (Dynamo 2.0.1.4955)

file_path = Filename("..\Desktop\electricalDemandFactor22.xls")
code_block = CodeBlock { "Demand Factors"; }
code_block_2 = CodeBlock { 0; }
code_block_3 = CodeBlock { ["Name","Calculation Method","Greater Than","Less or Equal to","Factor"]; }

# group: all demand factors
python_script = Python()  # unwired: IN[0]
# ---------- python_script.python (43 lines) ----------
import clr

clr.AddReference('RevitAPI')
from Autodesk.Revit.DB import *
from Autodesk.Revit.DB.Structure import *
from Autodesk.Revit.DB.Electrical import *


clr.AddReference('RevitAPIUI')
from Autodesk.Revit.UI import *

clr.AddReference('System')
from System.Collections.Generic import List

clr.AddReference('RevitNodes')
import Revit
clr.ImportExtensions(Revit.GeometryConversion)
clr.ImportExtensions(Revit.Elements)

clr.AddReference('RevitServices')
import RevitServices
from RevitServices.Persistence import DocumentManager
from RevitServices.Transactions import TransactionManager

doc = DocumentManager.Instance.CurrentDBDocument
uidoc=DocumentManager.Instance.CurrentUIApplication.ActiveUIDocument

#Preparing input from dynamo to revit
element = UnwrapElement(IN[0])


fd = FilteredElementCollector(doc).OfClass(ElectricalDemandFactorDefinition)

ele = [f for f in fd]

rangeOut = []

for e in ele:
	value = e.GetValues()
	for v in value:
		rangeOut.append([e.Name, e.RuleType, v.MinRange, v.MaxRange, v.Factor])

OUT = rangeOut
# ----------------------------------------

addItemToFront = List.AddItemToFront(item=code_block_3, list=python_script)
code_block_4 = CodeBlock { 1; }
exportExcel = Data.ExportExcel(filePath=file_path, sheetName=code_block, startRow=code_block_2, startCol=code_block_2, data=addItemToFront, overWrite=code_block_4)
code_block_5 = CodeBlock { "Load Classification Types"; }
code_block_6 = CodeBlock { ["Load Classification Type", "Demand Factor"]; }
python_script_2 = Python()  # unwired: IN[0]
# ---------- python_script_2.python (42 lines) ----------
import clr

clr.AddReference('RevitAPI')
from Autodesk.Revit.DB import *
from Autodesk.Revit.DB.Structure import *
from Autodesk.Revit.DB.Electrical import *


clr.AddReference('RevitAPIUI')
from Autodesk.Revit.UI import *

clr.AddReference('System')
from System.Collections.Generic import List

clr.AddReference('RevitNodes')
import Revit
clr.ImportExtensions(Revit.GeometryConversion)
clr.ImportExtensions(Revit.Elements)

clr.AddReference('RevitServices')
import RevitServices
from RevitServices.Persistence import DocumentManager
from RevitServices.Transactions import TransactionManager

doc = DocumentManager.Instance.CurrentDBDocument
uidoc=DocumentManager.Instance.CurrentUIApplication.ActiveUIDocument

#Preparing input from dynamo to revit
element = UnwrapElement(IN[0])



elc = FilteredElementCollector(doc).OfClass(ElectricalLoadClassification)

eLoadClass = [l for l in elc]

eLoadClassName = [e.Name for e in eLoadClass]

eLoadDemand = [doc.GetElement(e.DemandFactorId) for e in eLoadClass]


OUT = eLoadClassName, [e.Name for e in eLoadDemand]
# ----------------------------------------
transpose = List.Transpose(lists=python_script_2)
addItemToFront_2 = List.AddItemToFront(item=code_block_6, list=transpose)
exportExcel_2 = Data.ExportExcel(filePath=file_path, sheetName=code_block_5, startRow=code_block_2, startCol=code_block_2, data=addItemToFront_2, overWrite=code_block_4)
