# Dynamo graph energyModel.dyn (Dynamo 1.3.0.875)

select_model_elements = DSModelElementsSelection()
code_block = CodeBlock(a=select_model_elements) { a[1..3]; }
geometry = Element.Geometry(code_block)
code_block_2 = CodeBlock { 0; }
getItemAtIndex = List.GetItemAtIndex(list=geometry, index=code_block_2, lacing=Longest)
code_block_3 = CodeBlock { 0.5; }
normalAtParameter = Surface.NormalAtParameter(surface=getItemAtIndex, u=code_block_3, v=code_block_3)
python_script = Python(IN[0]=code_block)
# ---------- python_script.python (35 lines) ----------
import clr

clr.AddReference("RevitServices")
import RevitServices
from RevitServices.Persistence import DocumentManager
from RevitServices.Transactions import TransactionManager
doc = DocumentManager.Instance.CurrentDBDocument

clr.AddReference("RevitAPI")
import Autodesk
from Autodesk.Revit.DB import *

clr.AddReference("RevitNodes")
import Revit
clr.ImportExtensions(Revit.Elements)
clr.ImportExtensions(Revit.GeometryConversion)

energySrf = UnwrapElement(IN[0])

tilt = []
azi = []
type = []
openings = []
poly = []

for e in energySrf:
	tilt.append(e.Height)
	azi.append(e.Azimuth)
	type.append(e.Type)
	windows = e.GetAnalyticalOpenings()
	openings.append(windows)
	poly.append(e.GetPolyloop())
	
	
OUT = tilt, azi, type, openings, poly
# ----------------------------------------
code_block_4 = CodeBlock(a=python_script) { a[4]; }
python_script_2 = Python(IN[0]=code_block_4)
# ---------- python_script_2.python (26 lines) ----------
import clr

clr.AddReference("RevitServices")
import RevitServices
from RevitServices.Persistence import DocumentManager
from RevitServices.Transactions import TransactionManager
doc = DocumentManager.Instance.CurrentDBDocument

clr.AddReference("RevitAPI")
import Autodesk
from Autodesk.Revit.DB import *

clr.AddReference("RevitNodes")
import Revit
clr.ImportExtensions(Revit.Elements)
clr.ImportExtensions(Revit.GeometryConversion)

poly = UnwrapElement(IN[0])

loop = []
pts = []
for p in poly:
	loop.append(p.ComputeArea())
	pts.append(p.GetPoints())
#poly.ComputeArea()
OUT = loop, pts
# ----------------------------------------
select_model_elements_2 = DSModelElementsSelection()  # 1 picked in the model
python_script_3 = Python(IN[0]=select_model_elements_2)
# ---------- python_script_3.python (21 lines) ----------
import clr

clr.AddReference("RevitServices")
import RevitServices
from RevitServices.Persistence import DocumentManager
from RevitServices.Transactions import TransactionManager
doc = DocumentManager.Instance.CurrentDBDocument

clr.AddReference("RevitAPI")
import Autodesk
from Autodesk.Revit.DB import *

clr.AddReference("RevitNodes")
import Revit
clr.ImportExtensions(Revit.Elements)
clr.ImportExtensions(Revit.GeometryConversion)

energySrf = UnwrapElement(IN[0])
	
	
OUT = energySrf.GetAnalyticalOpenings()
# ----------------------------------------
geometry_2 = Element.Geometry(python_script_3)
code_block_5 = CodeBlock(a=geometry_2) { a[0]; }
area = Surface.Area(code_block_5)
python_script_4 = Python(IN[0]=python_script_3)
# ---------- python_script_4.python (27 lines) ----------
import clr

clr.AddReference("RevitServices")
import RevitServices
from RevitServices.Persistence import DocumentManager
from RevitServices.Transactions import TransactionManager
doc = DocumentManager.Instance.CurrentDBDocument

clr.AddReference("RevitAPI")
import Autodesk
from Autodesk.Revit.DB import *

clr.AddReference("RevitNodes")
import Revit
clr.ImportExtensions(Revit.Elements)
clr.ImportExtensions(Revit.GeometryConversion)

opt = Options()
opt.ComputeReferences = True
opt.IncludeNonVisibleObjects = True
opt.View = doc.ActiveView

energySrf = UnwrapElement(IN[0])


	
OUT = energySrf[0].GetPolyloop()
# ----------------------------------------
python_script_5 = Python(IN[0]=python_script_4)
# ---------- python_script_5.python (23 lines) ----------
import clr

clr.AddReference("RevitServices")
import RevitServices
from RevitServices.Persistence import DocumentManager
from RevitServices.Transactions import TransactionManager
doc = DocumentManager.Instance.CurrentDBDocument

clr.AddReference("RevitAPI")
import Autodesk
from Autodesk.Revit.DB import *

clr.AddReference("RevitNodes")
import Revit
clr.ImportExtensions(Revit.Elements)
clr.ImportExtensions(Revit.GeometryConversion)


poly = UnwrapElement(IN[0])


	
OUT = poly.ComputeArea()*1000, poly.GetPoints()
# ----------------------------------------
python_script_6 = Python(IN[0]=select_model_elements_2)
# ---------- python_script_6.python (27 lines) ----------
import clr

clr.AddReference("RevitServices")
import RevitServices
from RevitServices.Persistence import DocumentManager
from RevitServices.Transactions import TransactionManager
doc = DocumentManager.Instance.CurrentDBDocument

clr.AddReference("RevitAPI")
import Autodesk
from Autodesk.Revit.DB import *

clr.AddReference("RevitNodes")
import Revit
clr.ImportExtensions(Revit.Elements)
clr.ImportExtensions(Revit.GeometryConversion)

opt = Options()
opt.ComputeReferences = True
opt.IncludeNonVisibleObjects = True
opt.View = doc.ActiveView

energySrf = UnwrapElement(IN[0])


	
OUT = energySrf.GetPolyloop()
# ----------------------------------------
python_script_7 = Python(IN[0]=python_script_3)
# ---------- python_script_7.python (29 lines) ----------
import clr

clr.AddReference("RevitServices")
import RevitServices
from RevitServices.Persistence import DocumentManager
from RevitServices.Transactions import TransactionManager
doc = DocumentManager.Instance.CurrentDBDocument

clr.AddReference("RevitAPI")
import Autodesk
from Autodesk.Revit.DB import *

clr.AddReference("RevitNodes")
import Revit
clr.ImportExtensions(Revit.Elements)
clr.ImportExtensions(Revit.GeometryConversion)

opt = Options()
opt.ComputeReferences = True
opt.IncludeNonVisibleObjects = True
opt.View = doc.ActiveView

energySrf = UnwrapElement(IN[0])

geo = []
for obj in energySrf[0].get_Geometry(opt):
	geo.append(obj.ConvertToMany())
	
OUT = geo
# ----------------------------------------
python_script_8 = Python(IN[0]=python_script_3)
# ---------- python_script_8.python (30 lines) ----------
import clr

clr.AddReference("RevitServices")
import RevitServices
from RevitServices.Persistence import DocumentManager
from RevitServices.Transactions import TransactionManager
doc = DocumentManager.Instance.CurrentDBDocument

clr.AddReference("RevitAPI")
import Autodesk
from Autodesk.Revit.DB import *

clr.AddReference("RevitNodes")
import Revit
clr.ImportExtensions(Revit.Elements)
clr.ImportExtensions(Revit.GeometryConversion)

opt = Options()
opt.ComputeReferences = True
opt.IncludeNonVisibleObjects = True
opt.View = doc.ActiveView

energySrf = UnwrapElement(IN[0])

geo = []
for obj in energySrf[0].get_Geometry(opt):
	if isinstance(obj, Solid):
		geo.append(obj)
	
OUT = geo, geo[0].SurfaceArea/10.76391041671
# ----------------------------------------
code_block_6 = CodeBlock(a=python_script_8) { a[0]; }
python_script_9 = Python(IN[0]=code_block_6)
# ---------- python_script_9.python (30 lines) ----------
import clr

clr.AddReference("RevitServices")
import RevitServices
from RevitServices.Persistence import DocumentManager
from RevitServices.Transactions import TransactionManager
doc = DocumentManager.Instance.CurrentDBDocument

clr.AddReference("RevitAPI")
import Autodesk
from Autodesk.Revit.DB import *

clr.AddReference("RevitNodes")
import Revit
clr.ImportExtensions(Revit.Elements)
clr.ImportExtensions(Revit.GeometryConversion)

opt = Options()
opt.ComputeReferences = True
opt.IncludeNonVisibleObjects = True
opt.View = doc.ActiveView

geo = UnwrapElement(IN[0])

edges = geo[0].Edges
crv = []
for e in edges:
	crv.append(e.AsCurve().ToProtoType())
	
OUT = geo[0].SurfaceArea/10.76391041671, geo[0].Faces, edges, geo[0].Edges.GetEnumerator(), crv
# ----------------------------------------
code_block_7 = CodeBlock(a=python_script_9) { a[4]; }
byJoinedCurves = PolyCurve.ByJoinedCurves(code_block_7)
byPatch = Surface.ByPatch(byJoinedCurves)
area_2 = Surface.Area(byPatch)
code_block_8 = CodeBlock(a=python_script_9) { a[1]; }
python_script_10 = Python(IN[0]=code_block_8)
# ---------- python_script_10.python (27 lines) ----------
import clr

clr.AddReference("RevitServices")
import RevitServices
from RevitServices.Persistence import DocumentManager
from RevitServices.Transactions import TransactionManager
doc = DocumentManager.Instance.CurrentDBDocument

clr.AddReference("RevitAPI")
import Autodesk
from Autodesk.Revit.DB import *

clr.AddReference("RevitNodes")
import Revit
clr.ImportExtensions(Revit.Elements)
clr.ImportExtensions(Revit.GeometryConversion)

opt = Options()
opt.ComputeReferences = True
opt.IncludeNonVisibleObjects = True
opt.View = doc.ActiveView

face = UnwrapElement(IN[0])


	
OUT = face[0].ComputeNormal(UV(0.5,0.5))
# ----------------------------------------
