# Dynamo graph example1.dyn (Dynamo 2.0.1.4955)

# group: Input curves
select_model_element = DSModelElementSelection()  # 1 picked in the model
curves = Element.Curves(element=select_model_element)

# group: Division number
number = DoubleInput(0)
code_block = CodeBlock { 6; }
code_block_2 = CodeBlock { 1/5; }
sequence = Sequence(start=number, amount=code_block, step=code_block_2)

# group: Input curves
select_model_element_2 = DSModelElementSelection()  # 1 picked in the model
curves_2 = Element.Curves(element=select_model_element_2)

# group: Divide curves
pointAtParameter = Curve.PointAtParameter(curve=curves, param=sequence, lacing=Longest)
pointAtParameter_2 = Curve.PointAtParameter(curve=curves_2, param=sequence, lacing=Longest)

# group: Draw line
byStartPointEndPoint = Line.ByStartPointEndPoint(startPoint=pointAtParameter, endPoint=pointAtParameter_2)

# group: Division number (more efficient)
number_slider = DoubleSlider(6, range=0..100 step 0.1)
code_block_3 = CodeBlock(count=number_slider) { 0..1..#count; }
