# Dynamo graph excelToRevitBeams.dyn (Dynamo 2.1.0.5696)

categories = Categories(index=521)  # graph input
all_elements_of_category = ElementsOfCategory(Category=categories)
code_block = CodeBlock { "Reference Level"; }
getParameterValueByName = Element.GetParameterValueByName(parameterName=code_block)  # unwired: element
groupByFunction = List.GroupByFunction(list=all_elements_of_category, func=getParameterValueByName)
code_block_2 = CodeBlock { "Reference Level"; }
getParameterValueByName_2 = Element.GetParameterValueByName(element=groupByFunction, parameterName=code_block_2)
code_block_3 = CodeBlock { 0; }
getItemAtIndex = List.GetItemAtIndex(list=getParameterValueByName_2, index=code_block_3, lacing=Longest)
name = Element.Name(element=getItemAtIndex)

# group: Beam by Level
byKeysValues = DesignScript.Builtin.Dictionary.ByKeysValues(keys=name, values=groupByFunction)

code_block_4 = CodeBlock { "Level 47 - HR"; }
valueAtKey = DesignScript.Builtin.Dictionary.ValueAtKey(dictionary=byKeysValues, key=code_block_4)
file_path = Filename("C:\Users\giovanni.brogiolo\Desktop\CQT Beam Schedule_NJS.xlsx")  # graph input
fromPath = FileObject(path=file_path)  # "File.FromPath"
code_block_5 = CodeBlock { "Values"; }
code_block_6 = CodeBlock { 1; }
importExcel = Data.ImportExcel(file=fromPath, sheetName=code_block_5, readAsStrings=code_block_6)
code_block_7 = CodeBlock { 0..5; }
getItemAtIndex_2 = List.GetItemAtIndex(list=importExcel@L2, index=code_block_7@L2, lacing=Longest)
deconstruct = List.Deconstruct(list=getItemAtIndex_2, lacing=Longest)
deconstruct_2 = List.Deconstruct(list=deconstruct.rest, lacing=Longest)

# group: Beam Information
byKeysValues_2 = DesignScript.Builtin.Dictionary.ByKeysValues(keys=deconstruct.first, values=deconstruct_2.rest)

code_block_8 = CodeBlock { "Mark"; }
getParameterValueByName_3 = Element.GetParameterValueByName(element=valueAtKey, parameterName=code_block_8)
valueAtKey_2 = DesignScript.Builtin.Dictionary.ValueAtKey(dictionary=byKeysValues_2, key=getParameterValueByName_3)

# group: is null?
python_script = Python(IN[0]=valueAtKey_2)
# ---------- python_script.python (12 lines) ----------
# Enable Python support and load DesignScript library
import clr
clr.AddReference('ProtoGeometry')
from Autodesk.DesignScript.Geometry import *

# The inputs to this node will be stored as a list in the IN variables.
dataEnteringNode = IN

# Place your code below this line

# Assign your output to the OUT variable.
OUT = [i == None for i in IN[0]]
# ----------------------------------------

filterByBoolMask = List.FilterByBoolMask(list=valueAtKey, mask=python_script)
code_block_9 = CodeBlock { ["Profile","Grade","Camber","Shear Stud arrangement"]; }
filterByBoolMask_2 = List.FilterByBoolMask(list=valueAtKey_2, mask=python_script)
setParameterByName = Element.SetParameterByName(element=filterByBoolMask.out, parameterName=code_block_9@L2, value=filterByBoolMask_2.out, lacing=Longest)
