# Dynamo graph excelToRevitVoids.dyn (Dynamo 2.1.0.5696)

categories = Categories(index=521)  # graph input
all_elements_of_category = ElementsOfCategory(Category=categories)  # frozen
code_block = CodeBlock { "Reference Level"; }
getParameterValueByName = Element.GetParameterValueByName(parameterName=code_block)  # unwired: element
groupByFunction = List.GroupByFunction(list=all_elements_of_category, func=getParameterValueByName)
code_block_2 = CodeBlock { "Reference Level"; }
getParameterValueByName_2 = Element.GetParameterValueByName(element=groupByFunction, parameterName=code_block_2)
code_block_3 = CodeBlock { 0; }
getItemAtIndex = List.GetItemAtIndex(list=getParameterValueByName_2, index=code_block_3, lacing=Longest)
name = Element.Name(element=getItemAtIndex)

# group: Beam by Level
byKeysValues = DesignScript.Builtin.Dictionary.ByKeysValues(keys=name, values=groupByFunction)

code_block_4 = CodeBlock { "Level 47 - HR"; }
valueAtKey = DesignScript.Builtin.Dictionary.ValueAtKey(dictionary=byKeysValues, key=code_block_4)
file_path = Filename("C:\Users\giovanni.brogiolo\Desktop\CQT Beam Schedule_NJS.xlsx")  # graph input
fromPath = FileObject(path=file_path)  # "File.FromPath"
code_block_5 = CodeBlock { "Values"; }
code_block_6 = CodeBlock { 1; }
importExcel = Data.ImportExcel(file=fromPath, sheetName=code_block_5, readAsStrings=code_block_6)
code_block_7 = CodeBlock { 0; }
getItemAtIndex_2 = List.GetItemAtIndex(list=importExcel, index=code_block_7, lacing=Longest)
code_block_8 = CodeBlock { 6..55; }
getItemAtIndex_3 = List.GetItemAtIndex(list=importExcel@L2, index=code_block_8@L2, lacing=Longest)
code_block_9 = CodeBlock { 5; }
chop = List.Chop(list=getItemAtIndex_3, lengths=code_block_9, lacing=Longest)
python_script = Python(IN[0]=chop)
# ---------- python_script.python (14 lines) ----------
values = IN[0]

result = []

for va in values:
	sub = []
	result.append(sub)
	for v in va:
		sub.append(v[0]+v[1])



# Assign your output to the OUT variable.
OUT = [[v!="00" for v in r] for r in result]
# ----------------------------------------
filterByBoolMask = List.FilterByBoolMask(list=chop, mask=python_script)

# group: Void Information
byKeysValues_2 = DesignScript.Builtin.Dictionary.ByKeysValues(keys=getItemAtIndex_2, values=filterByBoolMask.in)

count = DesignScript.Builtin.Dictionary.Count(dictionary=byKeysValues_2, lacing=Longest)
select_model_elements = DSModelElementsSelection()  # 5 picked in the model
code_block_10 = CodeBlock { "Mark"; }
getParameterValueByName_3 = Element.GetParameterValueByName(element=select_model_elements, parameterName=code_block_10)
valueAtKey_2 = DesignScript.Builtin.Dictionary.ValueAtKey(dictionary=byKeysValues_2, key=getParameterValueByName_3)

# group: is null?
python_script_2 = Python(IN[0]=valueAtKey_2)
# ---------- python_script_2.python (12 lines) ----------
# Enable Python support and load DesignScript library
import clr
clr.AddReference('ProtoGeometry')
from Autodesk.DesignScript.Geometry import *

# The inputs to this node will be stored as a list in the IN variables.
dataEnteringNode = IN

# Place your code below this line

# Assign your output to the OUT variable.
OUT = [i == None for i in IN[0]]
# ----------------------------------------

filterByBoolMask_2 = List.FilterByBoolMask(list=valueAtKey_2, mask=python_script_2)
count_2 = List.Count(list=filterByBoolMask_2.out, lacing=Longest)
code_block_11 = CodeBlock(count=count_2) { 0.1..0.8..#count; }
filterByBoolMask_3 = List.FilterByBoolMask(list=select_model_elements, mask=python_script_2)
faces = Element.Faces(element=filterByBoolMask_3.out)
area = Surface.Area(surface=faces)
maximumItem = List.MaximumItem(list=area)
allIndicesOf = List.AllIndicesOf(list=area, item=maximumItem, lacing=Longest)
firstItem = List.FirstItem(list=allIndicesOf, lacing=Longest)
getItemAtIndex_4 = List.GetItemAtIndex(list=faces, index=firstItem, lacing=Longest)
code_block_12 = CodeBlock { 1; }
pointAtParameter = Surface.PointAtParameter(surface=getItemAtIndex_4, u=code_block_12, v=code_block_12)
code_block_13 = CodeBlock { 0.5; }
normalAtParameter = Surface.NormalAtParameter(surface=getItemAtIndex_4, u=code_block_13, v=code_block_13)
ZAxis = Vector.ZAxis()
cross = Vector.Cross(vector=normalAtParameter, cross=ZAxis)
byFace = FamilyInstance.ByFace(face=getItemAtIndex_4, location=pointAtParameter, referenceDirection=cross)  # unwired: familyType
location = FamilyInstance.Location(familyInstance=byFace)
select_model_element = DSModelElementSelection()  # 1 picked in the model
family_types = FamilyTypes(index=1745)
code_block_14 = CodeBlock { [2500, 4700]; }

# group: GeometryElement.Solid
python_script_3 = Python(IN[0]=select_model_element, IN[1]=family_types, IN[2]=code_block_14)
# ---------- python_script_3.python (94 lines) ----------
import clr

clr.AddReference('RevitAPI')
from Autodesk.Revit.DB import *
from Autodesk.Revit.DB.Structure import *

clr.AddReference('RevitAPIUI')
from Autodesk.Revit.UI import *

clr.AddReference('System')
from System.Collections.Generic import List

clr.AddReference('RevitNodes')
import Revit
clr.ImportExtensions(Revit.GeometryConversion)
clr.ImportExtensions(Revit.Elements)

clr.AddReference('RevitServices')
import RevitServices
from RevitServices.Persistence import DocumentManager
from RevitServices.Transactions import TransactionManager

doc = DocumentManager.Instance.CurrentDBDocument
uidoc=DocumentManager.Instance.CurrentUIApplication.ActiveUIDocument

#Preparing input from dynamo to revit
beam = UnwrapElement(IN[0])

distances = IN[2]

opt = Options()
opt.ComputeReferences = True
opt.IncludeNonVisibleObjects = False
opt.View = doc.ActiveView



geo = []
for obj in beam.get_Geometry(opt):
	if isinstance(obj, Solid):
		geo.append(obj)
		#geo.append(obj.ConvertToMany())

faces = []


for solid in geo:
	faces.Add(solid.Faces)
	
	
webFace = None

for fa in faces:
	areas = []
	for f in fa:
		areas.append(f.Area)
	try:
		webFace = fa[areas.IndexOf(max(areas))]
	except:
		continue


bboxUV = webFace.GetBoundingBox()
center = (bboxUV.Max + bboxUV.Min) * 0.5;
start = bboxUV.Min;
end = bboxUV.Max
length = abs(bboxUV.Min.U - bboxUV.Max.U)

midV = abs(start.V - end.V)/2

location = webFace.Evaluate(UV(start.U, midV));

normal = webFace.ComputeNormal(center);
refDir = normal.CrossProduct(XYZ.BasisZ);

#refDirBeam = beam.HandOrientation
#origin = beam.GetTransform().Origin


#direction = beam.Location.Curve.GetEndPoint(0) - beam.Location.Curve.GetEndPoint(1)

voidFamily = UnwrapElement(IN[1])

TransactionManager.Instance.EnsureInTransaction(doc)

for d in distances:
	void = doc.Create.NewFamilyInstance.Overloads[Reference, XYZ, XYZ, FamilySymbol](webFace.Reference, location, refDir, voidFamily);
	p = void.LookupParameter("Distance from Start")
	p.Set(d/304.8)
#void = doc.Create.NewFamilyInstance(location,fs,normal,beam,StructuralType.NonStructural);

TransactionManager.Instance.TransactionTaskDone()

OUT = location.ToPoint(), start, midV,length
# ----------------------------------------

faces_2 = Element.Faces(element=select_model_element)
area_2 = Surface.Area(surface=faces_2)
maximumItem_2 = List.MaximumItem(list=area_2)
code_block_15 = CodeBlock(a=maximumItem_2) { a/304.8/304.8; }
