# Dynamo graph excelToRevitVoids02.dyn (Dynamo 2.1.0.5696)

categories = Categories(index=521)  # graph input
all_elements_of_category = ElementsOfCategory(Category=categories)  # frozen
code_block = CodeBlock { "Reference Level"; }
getParameterValueByName = Element.GetParameterValueByName(parameterName=code_block)  # unwired: element
groupByFunction = List.GroupByFunction(list=all_elements_of_category, func=getParameterValueByName)
code_block_2 = CodeBlock { "Reference Level"; }
getParameterValueByName_2 = Element.GetParameterValueByName(element=groupByFunction, parameterName=code_block_2)
code_block_3 = CodeBlock { 0; }
getItemAtIndex = List.GetItemAtIndex(list=getParameterValueByName_2, index=code_block_3, lacing=Longest)
name = Element.Name(element=getItemAtIndex)

# group: Beam by Level
byKeysValues = DesignScript.Builtin.Dictionary.ByKeysValues(keys=name, values=groupByFunction)

code_block_4 = CodeBlock { "Level 47 - HR"; }
valueAtKey = DesignScript.Builtin.Dictionary.ValueAtKey(dictionary=byKeysValues, key=code_block_4)
select_model_elements = DSModelElementsSelection()  # 5 picked in the model
file_path = Filename("C:\Users\giovanni.brogiolo\Desktop\CQT Beam Schedule_NJS.xlsx")  # graph input
fromPath = FileObject(path=file_path)  # "File.FromPath"
code_block_5 = CodeBlock { "Values"; }
code_block_6 = CodeBlock { 1; }
importExcel = Data.ImportExcel(file=fromPath, sheetName=code_block_5, readAsStrings=code_block_6)
code_block_7 = CodeBlock { 0; }
getItemAtIndex_2 = List.GetItemAtIndex(list=importExcel, index=code_block_7, lacing=Longest)
code_block_8 = CodeBlock { 6..55; }
getItemAtIndex_3 = List.GetItemAtIndex(list=importExcel@L2, index=code_block_8@L2, lacing=Longest)
code_block_9 = CodeBlock { 5; }
chop = List.Chop(list=getItemAtIndex_3, lengths=code_block_9, lacing=Longest)
python_script = Python(IN[0]=chop)
# ---------- python_script.python (14 lines) ----------
values = IN[0]

result = []

for va in values:
	sub = []
	result.append(sub)
	for v in va:
		sub.append(v[0]+v[1])



# Assign your output to the OUT variable.
OUT = [[v!="00" for v in r] for r in result]
# ----------------------------------------
filterByBoolMask = List.FilterByBoolMask(list=chop, mask=python_script)

# group: Void Information
byKeysValues_2 = DesignScript.Builtin.Dictionary.ByKeysValues(keys=getItemAtIndex_2, values=filterByBoolMask.in)

count = DesignScript.Builtin.Dictionary.Count(dictionary=byKeysValues_2, lacing=Longest)
location = FamilyInstance.Location()  # unwired: familyInstance
select_model_elements_2 = DSModelElementsSelection()  # 2 picked in the model
code_block_10 = CodeBlock { "Mark"; }
getParameterValueByName_3 = Element.GetParameterValueByName(element=select_model_elements_2, parameterName=code_block_10)
valueAtKey_2 = DesignScript.Builtin.Dictionary.ValueAtKey(dictionary=byKeysValues_2, key=getParameterValueByName_3)

# group: is null?
python_script_2 = Python(IN[0]=valueAtKey_2)
# ---------- python_script_2.python (12 lines) ----------
# Enable Python support and load DesignScript library
import clr
clr.AddReference('ProtoGeometry')
from Autodesk.DesignScript.Geometry import *

# The inputs to this node will be stored as a list in the IN variables.
dataEnteringNode = IN

# Place your code below this line

# Assign your output to the OUT variable.
OUT = [i == None for i in IN[0]]
# ----------------------------------------

filterByBoolMask_2 = List.FilterByBoolMask(list=valueAtKey_2, mask=python_script_2)
python_script_3 = Python(IN[0]=select_model_elements_2, IN[1]=filterByBoolMask_2.out)
# ---------- python_script_3.python (16 lines) ----------
beams = IN[0]

info = IN[1]

for i in range(0,len(beams)):
	for j in range(0,len(info[i])):
		info[i][j].insert(0,beams[i])
	
	
result = []

for i in info:
	for j in i:
		result.append(j)
# Assign your output to the OUT variable.
OUT = result
# ----------------------------------------
family_types = FamilyTypes(index=1745)

# group: GeometryElement.Solid
python_script_4 = Python(IN[0]=python_script_3, IN[1]=family_types)
# ---------- python_script_4.python (148 lines) ----------
import clr

clr.AddReference('RevitAPI')
from Autodesk.Revit.DB import *
from Autodesk.Revit.DB.Structure import *

clr.AddReference('RevitAPIUI')
from Autodesk.Revit.UI import *

clr.AddReference('System')
from System.Collections.Generic import List

clr.AddReference('RevitNodes')
import Revit
clr.ImportExtensions(Revit.GeometryConversion)
clr.ImportExtensions(Revit.Elements)

clr.AddReference('RevitServices')
import RevitServices
from RevitServices.Persistence import DocumentManager
from RevitServices.Transactions import TransactionManager

doc = DocumentManager.Instance.CurrentDBDocument
uidoc=DocumentManager.Instance.CurrentUIApplication.ActiveUIDocument

# get the largest surface in a solid (i.e. the web face of the steel beam)
def GetFaceFromSolids(solids):
	faces = []
	for obj in solids:
		if isinstance(obj, Solid):
			faces.Add(obj.Faces)

	webFace = None

	for fa in faces:
		areas = []
		for f in fa:
			areas.append(f.Area)
		try:
			webFace = fa[areas.IndexOf(max(areas))]
		except:
			continue
	return webFace


def ExtractSymbolGeometry(beam, geometry):
	#instance = None
	symbolGeometry = None
	transform = None
	for item in geometry:
		try:
			#instance = item.GetInstanceGeometry()
			symbolGeometry = item.GetSymbolGeometry()
			transform = item.Transform
			
		except:
			continue
	
	return [GetFaceFromSolids(symbolGeometry), transform]



def GetBeamDirection(beam):
	return beam.Location.Curve.GetEndPoint(0) - beam.Location.Curve.GetEndPoint(1)


ele = IN[0]



def PlaceVoids(ele, distance, width, height):
	webFace = None
	
	opt = Options()
	opt.ComputeReferences = True
	opt.IncludeNonVisibleObjects = False
	
	instTransform = None;
	
	geometry = ele.get_Geometry(opt)
	
	solids = []
	for obj in geometry:
		solids.append(obj)
		#geo.append(obj.ConvertToMany())

	selectedFace = GetFaceFromSolids(geometry)
	
	if selectedFace == None:
		selectedFace = ExtractSymbolGeometry(ele, geometry)[0]
		instTransform = ExtractSymbolGeometry(ele, geometry)[1]

	bboxUV = selectedFace.GetBoundingBox()
	center = (bboxUV.Max + bboxUV.Min) * 0.5;
	start = bboxUV.Min;
	end = bboxUV.Max
	length = abs(bboxUV.Min.U - bboxUV.Max.U)
	
	midV = abs(start.V - end.V)/2
	
	location = selectedFace.Evaluate(UV(start.U, midV));
	
	loc = selectedFace.Evaluate(start);
	
	normal = selectedFace.ComputeNormal(center);
	refDir = normal.CrossProduct(XYZ.BasisZ);
	
	#refDirBeam = beam.HandOrientation
	#origin = beam.GetTransform().Origin

	voidFamily = UnwrapElement(IN[1])
	
	voids = []
	
	used = []
	
	TransactionManager.Instance.EnsureInTransaction(doc)
	
	if len(solids) == 1:
		transformedPoint = instTransform.OfPoint(location);
		direction = GetBeamDirection(ele)
		void = doc.Create.NewFamilyInstance.Overloads[Face, XYZ, XYZ, FamilySymbol](selectedFace, transformedPoint, direction, voidFamily);
		p = void.LookupParameter("Distance from Start")
		p.Set(distance/304.8)
		w = void.LookupParameter("Void Width")
		w.Set(width/304.8)
		h = void.LookupParameter("Void Height")
		h.Set(height/304.8)
		voids.append(void)
		used.append("instance")
	else:
		void = doc.Create.NewFamilyInstance.Overloads[Face, XYZ, XYZ, FamilySymbol](selectedFace, location,  GetBeamDirection(ele), voidFamily);
		p = void.LookupParameter("Distance from Start")
		p.Set(distance/304.8)
		w = void.LookupParameter("Void Width")
		w.Set(width/304.8)
		h = void.LookupParameter("Void Height")
		h.Set(height/304.8)
		voids.append(void)
		used.append("solid")
		
	#void = doc.Create.NewFamilyInstance(location,fs,normal,beam,StructuralType.NonStructural);
	
	TransactionManager.Instance.TransactionTaskDone()
	return voids[0], used[0]


OUT = [PlaceVoids(UnwrapElement(e[0]), float(e[1])*1000, int(e[3]), int(e[2])) for e in ele]
# ----------------------------------------

select_model_element = DSModelElementSelection()  # 1 picked in the model
faces = Element.Faces(element=select_model_element)
area = Surface.Area(surface=faces)
maximumItem = List.MaximumItem(list=area)
code_block_11 = CodeBlock(a=maximumItem) { a/304.8/304.8; }
code_block_12 = CodeBlock { [2500, 4700]; }
