# Dynamo graph excelToRevitVoids03.dyn (Dynamo 2.0.1.5055)

refresh = BoolSelector(true)

# group: Select beams
python_script = Python(IN[0]=refresh)
# ---------- python_script.python (52 lines) ----------
import clr

clr.AddReference('RevitAPI')
from Autodesk.Revit.DB import *
from Autodesk.Revit.DB.Structure import *


clr.AddReference('RevitAPIUI')
from Autodesk.Revit.UI import *
from Autodesk.Revit.UI.Selection import *


clr.AddReference('System')
from System.Collections.Generic import List

clr.AddReference('RevitNodes')
import Revit
clr.ImportExtensions(Revit.GeometryConversion)
clr.ImportExtensions(Revit.Elements)

clr.AddReference('RevitServices')
import RevitServices
from RevitServices.Persistence import DocumentManager
from RevitServices.Transactions import TransactionManager

import math
from System.Collections.Generic import Dictionary,List

doc = DocumentManager.Instance.CurrentDBDocument
uidoc=DocumentManager.Instance.CurrentUIApplication.ActiveUIDocument


class CustomISelectionFilter(ISelectionFilter):
	def __init__(self, category_name):
		self.category_name = category_name
	def AllowElement(self, e):
		if e.Category.Name == self.category_name:
			return True
		else:
			return False
	def AllowReference(self, ref, point):
		return false
		

try:
    beam = uidoc.Selection.PickObjects(ObjectType.Element, CustomISelectionFilter("Structural Framing"), "Select a Beam")
    TaskDialog.Show("Result", "You have selected " + str(len(beam)) + " beams")
except:
    TaskDialog.Show("Operation Cancelled","The user cancelled the operation")
    
    
OUT = [doc.GetElement(b) for b in beam]
# ----------------------------------------

file_path = Filename("..\Detached Model\CQT Beam Schedule_UGF.xlsx")  # graph input
fromPath = FileObject(path=file_path)  # "File.FromPath"
code_block = CodeBlock { "Values"; }
code_block_2 = CodeBlock { 1; }
importExcel = Data.ImportExcel(file=fromPath, sheetName=code_block, readAsStrings=code_block_2)
code_block_3 = CodeBlock { 0; }
getItemAtIndex = List.GetItemAtIndex(list=importExcel, index=code_block_3, lacing=Longest)
code_block_4 = CodeBlock { 6..55; }
getItemAtIndex_2 = List.GetItemAtIndex(list=importExcel@L2, index=code_block_4@L2, lacing=Longest)
code_block_5 = CodeBlock { 5; }
chop = List.Chop(list=getItemAtIndex_2, lengths=code_block_5, lacing=Longest)
python_script_2 = Python(IN[0]=chop)
# ---------- python_script_2.python (14 lines) ----------
values = IN[0]

result = []

for va in values:
	sub = []
	result.append(sub)
	for v in va:
		sub.append(v[0]+v[1])



# Assign your output to the OUT variable.
OUT = [[v!="00" for v in r] for r in result]
# ----------------------------------------
filterByBoolMask = List.FilterByBoolMask(list=chop, mask=python_script_2)

# group: Void Information
byKeysValues = DesignScript.Builtin.Dictionary.ByKeysValues(keys=getItemAtIndex, values=filterByBoolMask.in)

code_block_6 = CodeBlock { "Mark"; }
getParameterValueByName = Element.GetParameterValueByName(element=python_script, parameterName=code_block_6)
valueAtKey = DesignScript.Builtin.Dictionary.ValueAtKey(dictionary=byKeysValues, key=getParameterValueByName)

# group: is null?
python_script_3 = Python(IN[0]=valueAtKey)
# ---------- python_script_3.python (12 lines) ----------
# Enable Python support and load DesignScript library
import clr
clr.AddReference('ProtoGeometry')
from Autodesk.DesignScript.Geometry import *

# The inputs to this node will be stored as a list in the IN variables.
dataEnteringNode = IN

# Place your code below this line

# Assign your output to the OUT variable.
OUT = [i == None for i in IN[0]]
# ----------------------------------------

filterByBoolMask_2 = List.FilterByBoolMask(list=python_script, mask=python_script_3)
filterByBoolMask_3 = List.FilterByBoolMask(list=valueAtKey, mask=python_script_3)
python_script_4 = Python(IN[0]=filterByBoolMask_2.out, IN[1]=filterByBoolMask_3.out, IN[2]=getParameterValueByName)
# ---------- python_script_4.python (21 lines) ----------
beams = IN[0]

info = IN[1]

mark = IN[2]


for i in range(0,len(beams)):
	for j in range(0,len(info[i])):
		info[i][j].insert(0,beams[i])
		info[i][j].insert(6,mark[i])
		info[i][j].insert(7,j+1)
	
	
result = []

for i in info:
	for j in i:
		result.append(j)
# Assign your output to the OUT variable.
OUT = result
# ----------------------------------------
code_block_7 = CodeBlock { "Web_Peno_R"; }
byName = FamilyType.ByName(name=code_block_7)
byName_2 = FamilyType.ByName(name=code_block_7)
refresh_2 = BoolSelector(false)

# group: GeometryElement.Solid
python_script_5 = Python(IN[0]=python_script_4, IN[1]=byName, IN[2]=byName_2, IN[3]=refresh_2)
# ---------- python_script_5.python (170 lines) ----------
import clr

clr.AddReference('RevitAPI')
from Autodesk.Revit.DB import *
from Autodesk.Revit.DB.Structure import *

clr.AddReference('RevitAPIUI')
from Autodesk.Revit.UI import *

clr.AddReference('System')
from System.Collections.Generic import List

clr.AddReference('RevitNodes')
import Revit
clr.ImportExtensions(Revit.GeometryConversion)
clr.ImportExtensions(Revit.Elements)

clr.AddReference('RevitServices')
import RevitServices
from RevitServices.Persistence import DocumentManager
from RevitServices.Transactions import TransactionManager

doc = DocumentManager.Instance.CurrentDBDocument
uidoc=DocumentManager.Instance.CurrentUIApplication.ActiveUIDocument

# get the largest surface in a solid (i.e. the web face of the steel beam)
def GetFaceFromSolids(solids):
	faces = []
	for obj in solids:
		if isinstance(obj, Solid):
			faces.Add(obj.Faces)

	webFace = None

	for fa in faces:
		areas = []
		for f in fa:
			areas.append(f.Area)
		try:
			webFace = fa[areas.IndexOf(max(areas))]
		except:
			continue
	return webFace


def ExtractSymbolGeometry(beam, geometry):
	#instance = None
	symbolGeometry = None
	transform = None
	for item in geometry:
		try:
			#instance = item.GetInstanceGeometry()
			symbolGeometry = item.GetSymbolGeometry()
			transform = item.Transform
			
		except:
			continue
	
	return [GetFaceFromSolids(symbolGeometry), transform]



def GetBeamDirection(beam):
	return beam.Location.Curve.GetEndPoint(0) - beam.Location.Curve.GetEndPoint(1)


def SetVoidSize(void, distance, width, height, mark, id):
		p = void.LookupParameter("P_Distance from Start")
		p.Set(distance/304.8)
		w = void.LookupParameter("P_Void Width")
		w.Set(width/304.8)
		h = void.LookupParameter("P_Void Depth")
		h.Set(height/304.8)
		t = void.LookupParameter("P_Beam Tag")
		t.Set(mark)
		t = void.LookupParameter("P_Penetration Id")
		t.Set(id)
		
def SetCircularVoidSize(void, distance, height, mark, id):
		p = void.LookupParameter("P_Distance from Start")
		p.Set(distance/304.8)
		h = void.LookupParameter("P_Void Depth")
		h.Set(height/304.8)
		t = void.LookupParameter("P_Beam Tag")
		t.Set(mark)
		t = void.LookupParameter("P_Penetration Id")
		t.Set(id)

ele = IN[0]



def PlaceVoids(ele, distance, width, height, mark, id):
	webFace = None
	
	opt = Options()
	opt.ComputeReferences = True
	opt.IncludeNonVisibleObjects = False
	
	instTransform = None;
	
	geometry = ele.get_Geometry(opt)
	
	solids = []
	for obj in geometry:
		solids.append(obj)
		#geo.append(obj.ConvertToMany())

	selectedFace = GetFaceFromSolids(geometry)
	
	if selectedFace == None:
		selectedFace = ExtractSymbolGeometry(ele, geometry)[0]
		instTransform = ExtractSymbolGeometry(ele, geometry)[1]

	bboxUV = selectedFace.GetBoundingBox()
	center = (bboxUV.Max + bboxUV.Min) * 0.5;
	start = bboxUV.Min;
	end = bboxUV.Max
	length = abs(bboxUV.Min.U - bboxUV.Max.U)
	
	midV = abs(start.V - end.V)/2
	
	location = selectedFace.Evaluate(UV(start.U, midV));
	
	#loc = selectedFace.Evaluate(start);
	
	normal = selectedFace.ComputeNormal(center);
	refDir = normal.CrossProduct(XYZ.BasisZ);
	
	#refDirBeam = beam.HandOrientation
	#origin = beam.GetTransform().Origin

	voidFamily = UnwrapElement(IN[1])
	
	circularVoidFamily = UnwrapElement(IN[2])
	
	voids = []
	
	used = []
	
	TransactionManager.Instance.EnsureInTransaction(doc)
	
	if len(solids) == 1:
		transformedPoint = instTransform.OfPoint(location);
		#direction = GetBeamDirection(ele)
		if width>0:
			void = doc.Create.NewFamilyInstance.Overloads[Face, XYZ, XYZ, FamilySymbol](selectedFace, transformedPoint, GetBeamDirection(ele), voidFamily);
			SetVoidSize(void, distance, width, height, mark, id)
		else:
			void = doc.Create.NewFamilyInstance.Overloads[Face, XYZ, XYZ, FamilySymbol](selectedFace, transformedPoint, GetBeamDirection(ele), circularVoidFamily);
			SetCircularVoidSize(void, distance, height, mark, id)
		voids.append(void)
		used.append("instance")
	else:
		if width>0:
			void = doc.Create.NewFamilyInstance.Overloads[Face, XYZ, XYZ, FamilySymbol](selectedFace, location,  GetBeamDirection(ele), voidFamily);
			SetVoidSize(void, distance, width, height, mark, id)
		else:
			void = doc.Create.NewFamilyInstance.Overloads[Face, XYZ, XYZ, FamilySymbol](selectedFace, location,  GetBeamDirection(ele), circularVoidFamily);
			SetCircularVoidSize(void, distance, height, mark, id)
		voids.append(void)
		used.append("solid")
		
	#void = doc.Create.NewFamilyInstance(location,fs,normal,beam,StructuralType.NonStructural);
	
	TransactionManager.Instance.TransactionTaskDone()
	return voids[0], used[0]


OUT = [PlaceVoids(UnwrapElement(e[0]), float(e[1]), int(e[3]), int(e[2]), e[6], str(e[7])) for e in ele]
# ----------------------------------------

code_block_8 = CodeBlock { "Web Penetration with Stiffeners-C"; }
