# Dynamo graph filterSelection.dyn (Dynamo 2.0.1.5055)

code_block = CodeBlock { "Wall 2"; }
python_script = Python(IN[0]=code_block)
# ---------- python_script.python (45 lines) ----------
import clr

clr.AddReference("RevitAPIUI")
from Autodesk.Revit.UI import IExternalEventHandler, ExternalEvent, TaskDialog
from Autodesk.Revit.UI.Selection import *

clr.AddReference("RevitAPI")
from Autodesk.Revit.DB import Transaction, OverrideGraphicSettings, ElementId, Color
# noinspection PyUnresolvedReferences
from Autodesk.Revit.Exceptions import InvalidOperationException


clr.AddReference('RevitServices')
from RevitServices.Persistence import DocumentManager


global result



doc = DocumentManager.Instance.CurrentDBDocument
uidoc = DocumentManager.Instance.CurrentUIApplication.ActiveUIDocument


class CustomISelectionFilter(ISelectionFilter):
	def __init__(self, category_name, family_name):
		self.category_name = category_name
		self.family_name = family_name
	def AllowElement(self, e):
		if e.Category.Name == self.category_name and e.Name == self.family_name:
			return True
		else:
			return False
	def AllowReference(self, ref, point):
		return false

famName = IN[0]

ref = uidoc.Selection.PickObjects(ObjectType.Element, CustomISelectionFilter("Walls", famName), "Select Walls")

result = []



OUT = [doc.GetElement(r) for r in ref]
# ----------------------------------------
