# Dynamo graph findBeamTag.dyn (Dynamo 1.3.3.4651)

select_model_elements = DSModelElementsSelection()  # 492 picked in the model
code_block = CodeBlock { "Mark"; }
getParameterValueByName = Element.GetParameterValueByName(element=select_model_elements, parameterName=code_block)
code_block_2 = CodeBlock { "1G-CB343"; }
eq = getParameterValueByName == code_block_2
filterByBoolMask = List.FilterByBoolMask(list=select_model_elements, mask=eq)
allIndicesOf = List.AllIndicesOf(list=getParameterValueByName, item=code_block_2)
getItemAtIndex = List.GetItemAtIndex(list=select_model_elements, index=allIndicesOf)
