# Dynamo graph findClosestLevel_02.dyn (Dynamo 0.8.2.2392)

# group: All categories
python_script = Python()
# ---------- python_script.python (38 lines) ----------
import clr
# Import RevitAPI
clr.AddReference("RevitAPI")
from Autodesk.Revit.DB import *
clr.AddReference("RevitAPIUI")
from Autodesk.Revit.UI import TaskDialog
# Import DocumentManager and TransactionManager
clr.AddReference("RevitServices")
from RevitServices.Persistence import DocumentManager
from RevitServices.Transactions import TransactionManager
# Import ToProtoType, ToRevitType geometry conversion extension methods
clr.AddReference("RevitNodes")
import Revit
clr.ImportExtensions(Revit.Elements)
clr.ImportExtensions(Revit.GeometryConversion)

doc = DocumentManager.Instance.CurrentDBDocument
uiapp = DocumentManager.Instance.CurrentUIApplication
app = uiapp.Application

collector = FilteredElementCollector( doc ).WhereElementIsNotElementType()

cat = []
bboxMin = []
bboxMax = []
error = []

for c in collector:
	if (None != c.Category and c.Category.HasMaterialQuantities):
		try:
			bboxMin.append(c.get_BoundingBox(None).Min.ToPoint().Z)
			bboxMax.append(c.get_BoundingBox(None).Max.ToPoint().Z)
			cat.append(c)
		except:
			error.append(c)
			

OUT = cat, bboxMin,bboxMax, error
# ----------------------------------------

code_block = CodeBlock(a=python_script) { a[0]; }
code_block_2 = CodeBlock { "Level"; }
categories = Categories("Levels")
all_elements_of_category = ElementsOfCategory(categories)
name = Level.Name(all_elements_of_category)

# group: Level Names
python_script_2 = Python(IN[0]=name)
# ---------- python_script_2.python (15 lines) ----------
import clr
clr.AddReference('ProtoGeometry')
from Autodesk.DesignScript.Geometry import *

names = IN[0]

level = []

for s in names:
	start = s.find("-")+1
	end = start+4
	level.append(s[start:end])

#Assign your output to the OUT variable.
OUT = level
# ----------------------------------------

restOfItems = List.RestOfItems(python_script_2)
elevation = Level.Elevation(all_elements_of_category)
restOfItems_2 = List.RestOfItems(elevation)
code_block_3 = CodeBlock(a=python_script) { a[1]; }

# group: Min Point Z
python_script_3 = Python(IN[0]=restOfItems_2, IN[1]=code_block_3)
# ---------- python_script_3.python (6 lines) ----------
import clr

levels = IN[0]
toFind = IN[1]

OUT = [min(enumerate(levels), key=lambda x: abs(x[1]-f)) for f in toFind]
# ----------------------------------------

code_block_4 = CodeBlock { 0; }
getItemAtIndex = List.GetItemAtIndex(list=python_script_3, index=code_block_4, lacing=Longest)
getItemAtIndex_2 = List.GetItemAtIndex(list=restOfItems, index=getItemAtIndex)
code_block_5 = CodeBlock(a=python_script) { a[2]; }

# group: Max Point Z
python_script_4 = Python(IN[0]=restOfItems_2, IN[1]=code_block_5)  # same code as python_script_3

code_block_6 = CodeBlock { 0; }
getItemAtIndex_3 = List.GetItemAtIndex(list=python_script_4, index=code_block_6, lacing=Longest)
getItemAtIndex_4 = List.GetItemAtIndex(list=restOfItems, index=getItemAtIndex_3)
code_block_7 = CodeBlock(bot=getItemAtIndex_2, top=getItemAtIndex_4) { bot + top; }
setParameterByName = Element.SetParameterByName(element=code_block, parameterName=code_block_2, value=code_block_7)
