# Dynamo graph findClosestPoints.dyn (Dynamo 2.0.1.4955)

# group: Select all the elements of a category
categories = Categories(index=521)
all_elements_of_category = ElementsOfCategory(Category=categories)

# group: Level names
code_block = CodeBlock { ["B6","P5","B4","B3","B2","B1"]; }

# group: Level Elevations [mm]
code_block_2 = CodeBlock { [-1,-0,1,2,3,4]; }

# group: Get the element bounding box
boundingBox = Element.BoundingBox(element=all_elements_of_category)

# group: Find the bottom Z value
minPoint = BoundingBox.MinPoint(boundingBox=boundingBox)
Z = Point.Z(point=minPoint)

# group: Find the closest Level (and its index)
python_script = Python(IN[0]=code_block_2, IN[1]=Z)
# ---------- python_script.python (6 lines) ----------
import clr

levels = IN[0]
toFind = IN[1]

OUT = [min(enumerate(levels), key=lambda x: abs(x[1]-f)) for f in toFind]
# ----------------------------------------

# group: Retrieve the Level's name
code_block_3 = CodeBlock { 0; }
getItemAtIndex = List.GetItemAtIndex(list=python_script, index=code_block_3, lacing=Longest)
getItemAtIndex_2 = List.GetItemAtIndex(list=code_block, index=getItemAtIndex)

# group: Find the top Z value
maxPoint = BoundingBox.MaxPoint(boundingBox=boundingBox)
Z_2 = Point.Z(point=maxPoint)

# group: Same as above
python_script_2 = Python(IN[0]=code_block_2, IN[1]=Z_2)  # same code as python_script
code_block_4 = CodeBlock { 0; }
getItemAtIndex_3 = List.GetItemAtIndex(list=python_script_2, index=code_block_4, lacing=Longest)
getItemAtIndex_4 = List.GetItemAtIndex(list=code_block, index=getItemAtIndex_3)

# group: Write levels to Revit
code_block_5 = CodeBlock { "Comments"; }
code_block_6 = CodeBlock(bot=getItemAtIndex_2, top=getItemAtIndex_4) { "Bottom Level:"+bot+" - Top Level:"+top; }
setParameterByName = Element.SetParameterByName(element=all_elements_of_category, parameterName=code_block_5, value=code_block_6)
