# Dynamo graph findGroupsOnSheets.dyn (Dynamo 0.8.2.2392)

element_types = ElementTypes("Group")
all_elements_of_type = ElementsOfType(element_types)
ownerView = Custom[Element.OwnerView](element=all_elements_of_type)  # Gets the owner view of a given Revit element (if possible)
name = Element.Name(all_elements_of_type)
uniqueItems = List.UniqueItems(name)

# group: GROUP NAMES
sort = List.Sort(uniqueItems)

allIndicesOf = List.AllIndicesOf(list=name, item=sort)
getItemAtIndex = List.GetItemAtIndex(list=ownerView, index=allIndicesOf)

# group: SHEET NUMBER
python_script = Python(IN[0]=getItemAtIndex)
# ---------- python_script.python (19 lines) ----------
import clr
clr.AddReference('ProtoGeometry')
from Autodesk.DesignScript.Geometry import *
#The inputs to this node will be stored as a list in the IN variables.
data = IN[0]

result = []

for i in range(0,len(data)):
	r = []
	result.append(r)
	for j in range(0,len(data[i])):
		if data[i][j].GetType().ToString() == "Revit.Elements.Views.Sheet":
			r.append(data[i][j].SheetNumber)
		else:
			r.append("Not on sheet")
	
#Assign your output to the OUT variable.
OUT = result
# ----------------------------------------
