# Dynamo graph findSectionTypeByName.dyn (Dynamo 2.0.1.4955)

categories = Categories(index=587)
all_elements_of_category = ElementsOfCategory(Category=categories)
getType = WombatDynamo.Element.GetType(element=all_elements_of_category)
removeNulls = Lists.Manage.RemoveNulls(Data=getType)
removeItemAtIndex = List.RemoveItemAtIndex(list=all_elements_of_category, indices=removeNulls.Indices)
name = Element.Name(element=removeNulls.Cleaned)
code_block = CodeBlock { "G.A."; }
contains = String.Contains(str=name, searchFor=code_block)
filterByBoolMask = List.FilterByBoolMask(list=removeItemAtIndex, mask=contains)
name_2 = Element.Name()  # unwired: element
groupByFunction = List.GroupByFunction(list=removeNulls.Cleaned, func=name_2)
name_3 = Element.Name(element=groupByFunction)
ownerView = Custom[Element.OwnerView]()  # Gets the owner view of a given Revit element (if possible); unwired: element
code_block_2 = CodeBlock { a[17]; }  # unwired: a
python_script = Python()  # unwired: IN[0], IN[1]
# ---------- python_script.python (34 lines) ----------
import clr

clr.AddReference('RevitAPI')
from Autodesk.Revit.DB import *
from Autodesk.Revit.DB.Structure import *

clr.AddReference('RevitAPIUI')
from Autodesk.Revit.UI import *

clr.AddReference('System')
from System.Collections.Generic import List

clr.AddReference('RevitNodes')
import Revit
clr.ImportExtensions(Revit.GeometryConversion)
clr.ImportExtensions(Revit.Elements)

clr.AddReference('RevitServices')
import RevitServices
from RevitServices.Persistence import DocumentManager
from RevitServices.Transactions import TransactionManager

doc = DocumentManager.Instance.CurrentDBDocument
uidoc=DocumentManager.Instance.CurrentUIApplication.ActiveUIDocument

#Preparing input from dynamo to revit
element = UnwrapElement(IN[0])

#Do some action in a Transaction
TransactionManager.Instance.EnsureInTransaction(doc)

TransactionManager.Instance.TransactionTaskDone()

OUT = 0
# ----------------------------------------
getType_2 = WombatDynamo.Element.GetType()  # unwired: element
groupByFunction_2 = List.GroupByFunction(list=all_elements_of_category, func=getType_2)
code_block_3 = CodeBlock(a=groupByFunction_2) { a[18]; }
getType_3 = WombatDynamo.Element.GetType(element=code_block_3)
name_4 = Element.Name(element=getType_3)
ownerView_2 = Custom[Element.OwnerView](element=code_block_3)
