# Dynamo graph findViewNotOnSheet_v132.dyn (Dynamo 1.3.2.2480)

deleteElements = Custom[Springs.Doc.DeleteElements]()  # Attempts to delete the input list of elements from the active Revit document.The node returns the number of successfully deleted elements and their Ids as a string. Carefully observe the deleted elements count. It may be greater than the input list because hosted elements or tags will be deleted as well. If an element in the list can not be deleted (for example last revision or last view), the whole list will fail to be deleted.; unwired: element, confirm

# group: Refresh
boolean = BoolSelector(true)

python_script = Python(IN[0]=boolean)
# ---------- python_script.python (98 lines) ----------
import clr

clr.AddReference('RevitAPI')
from Autodesk.Revit.DB import *
from Autodesk.Revit.DB.Structure import *

clr.AddReference('RevitAPIUI')
from Autodesk.Revit.UI import *

clr.AddReference('System')
from System.Collections.Generic import List

clr.AddReference('RevitNodes')
import Revit
clr.ImportExtensions(Revit.GeometryConversion)
clr.ImportExtensions(Revit.Elements)

clr.AddReference('RevitServices')
import RevitServices
from RevitServices.Persistence import DocumentManager
from RevitServices.Transactions import TransactionManager

doc = DocumentManager.Instance.CurrentDBDocument
uidoc=DocumentManager.Instance.CurrentUIApplication.ActiveUIDocument


# COLLECTING DATA
dviews = []
mviews = []
lviews = []
scheduleviews = []
all_sheeted_view_ids = []

# Collecting all the model, drafting, and legend views
views = FilteredElementCollector(doc).OfCategory(BuiltInCategory.OST_Views).WhereElementIsNotElementType().ToElements()

for v in views:
    if not v.IsTemplate:
        if v.ViewType == ViewType.DraftingView:
            dviews.append(v)
        elif v.ViewType == ViewType.Legend:
            lviews.append(v)
        else:
            mviews.append(v)

# Schedules need to be collected separately
schedule_views = FilteredElementCollector(doc).OfClass(ViewSchedule).WhereElementIsNotElementType().ToElements()

for sv in schedule_views:
    scheduleviews.append(sv)

# Now collecting all sheets and find all sheeted views
sheets = FilteredElementCollector(doc).OfCategory(BuiltInCategory.OST_Sheets).WhereElementIsNotElementType().ToElements()

for sht in sheets:
    vp_ids = [doc.GetElement(x).ViewId for x in sht.GetAllViewports()]
    all_sheeted_view_ids.extend(vp_ids)


# Find all sheeted schedule views and add them to the list as well
allSheetedSchedules = FilteredElementCollector(doc).OfClass(ScheduleSheetInstance).ToElements()

for ss in allSheetedSchedules:
    all_sheeted_view_ids.append(ss.ScheduleId)

# NOW LET'S REPORT
list0 = ['DRAFTING VIEWS NOT ON ANY SHEETS']
for v in dviews:
    if v.Id in all_sheeted_view_ids:
        continue
    else:
        list0.append([v.ViewName,doc.GetElement(v.Id)])


list1 = ['MODEL VIEWS NOT ON ANY SHEETS']
for v in mviews:
    if v.Id in all_sheeted_view_ids:
        continue
    else:
        list1.append([v.ViewName,doc.GetElement(v.Id)])


list2 = ['LEGENDS NOT ON ANY SHEETS']
for v in lviews:
    if v.Id in all_sheeted_view_ids:
        continue
    else:
        list2.append([v.ViewName,doc.GetElement(v.Id)])


list3 = ['SCHEDULES NOT ON ANY SHEETS']
for v in scheduleviews:
    if v.Id in all_sheeted_view_ids:
        continue
    else:
        list3.append([v.ViewName,doc.GetElement(v.Id)])

OUT = list1, list2, list3
# ----------------------------------------
code_block = CodeBlock { 2; }
getItemAtIndex = List.GetItemAtIndex(list=python_script, index=code_block)
restOfItems = List.RestOfItems(getItemAtIndex)
transpose = List.Transpose(restOfItems)
deconstruct = List.Deconstruct(list=transpose)
code_block_2 = CodeBlock(scheduleToBeDeleted=deconstruct.rest) { scheduleToBeDeleted[0]; }
boolean_2 = BoolSelector(true)
python_script_2 = Python(IN[0]=code_block_2, IN[1]=boolean_2)
# ---------- python_script_2.python (35 lines) ----------
#Copyright(c) 2016, Dimitar Venkov
# @5devene, dimitar.ven@gmail.com

import clr

clr.AddReference("RevitServices")
import RevitServices
from RevitServices.Persistence import DocumentManager
from RevitServices.Transactions import TransactionManager
doc = DocumentManager.Instance.CurrentDBDocument

def tolist(obj1):
	if hasattr(obj1,"__iter__"): return obj1
	else: return [obj1]

elems = UnwrapElement(tolist(IN[0]) )

if IN[1]:
	deleted, failed = [], []
	TransactionManager.Instance.EnsureInTransaction(doc)
	for e in elems:
		id = None
		try:
			id = e.Id
			del_id = doc.Delete(id)
			deleted.extend([d.ToString() for d in del_id])
		except:
			if id is not None:
				failed.append(id.ToString() )
	TransactionManager.Instance.TransactionTaskDone()
	s = set(deleted)
	failed1 = [x for x in failed if x not in s]
	OUT = len(deleted), ';'.join(deleted), ';'.join(failed1)
else:
	OUT = "Set confirm to True", "", ""
# ----------------------------------------
