# Dynamo graph getAnalyticalLine.dyn (Dynamo 2.0.1.5055)

select_model_elements = DSModelElementsSelection()  # 1 picked in the model
getLocation = Element.GetLocation(element=select_model_elements)
detail_level = DetailLevel(index=0)
current = Document.Current()
activeView = Document.ActiveView(document=current)
geometry = Custom[Element.Geometry+](element=select_model_elements, detailLevel=detail_level, view=activeView)  # Returns Dynamo AND native Revit geometry of a given element
python_script = Python(IN[0]=select_model_elements)
# ---------- python_script.python (30 lines) ----------
import clr

clr.AddReference('RevitAPI')
from Autodesk.Revit.DB import *
from Autodesk.Revit.DB.Structure import *

clr.AddReference('RevitAPIUI')
from Autodesk.Revit.UI import *

clr.AddReference('System')
from System.Collections.Generic import List

clr.AddReference('RevitNodes')
import Revit
clr.ImportExtensions(Revit.GeometryConversion)
clr.ImportExtensions(Revit.Elements)

clr.AddReference('RevitServices')
import RevitServices
from RevitServices.Persistence import DocumentManager
from RevitServices.Transactions import TransactionManager

doc = DocumentManager.Instance.CurrentDBDocument
uidoc=DocumentManager.Instance.CurrentUIApplication.ActiveUIDocument

#Preparing input from dynamo to revit
beam = UnwrapElement(IN[0])


OUT = beam.GetAnalyticalModel().GetCurve().ToProtoType()
# ----------------------------------------
byCurve = ModelCurve.ByCurve(curve=python_script)
