# Dynamo graph getCableTrayTags.dyn (Dynamo 0.8.2.2392)

categories = Categories("CableTrayTags")
all_elements_of_category = ElementsOfCategory(categories)
python_script = Python(IN[0]=all_elements_of_category)
# ---------- python_script.python (32 lines) ----------
#Copyright(c) 2015, Konrad K Sobon
# @arch_laboratory, http://archi-lab.net

import clr
clr.AddReference('ProtoGeometry')
from Autodesk.DesignScript.Geometry import *

# Import DocumentManager and TransactionManager
clr.AddReference("RevitServices")
import RevitServices
from RevitServices.Persistence import DocumentManager
from RevitServices.Transactions import TransactionManager

doc = DocumentManager.Instance.CurrentDBDocument
uiapp = DocumentManager.Instance.CurrentUIApplication
app = uiapp.Application

# Import RevitAPI
clr.AddReference("RevitAPI")
import Autodesk
from Autodesk.Revit.DB import *

tags= UnwrapElement(IN[0])

elements = []

for t in tags:
	elements.append(t.GetTaggedLocalElement())
		

#Assign your output to the OUT variable
OUT = elements
# ----------------------------------------
select_model_elements = DSModelElementsSelection()
ownerView = Custom[Element.OwnerView](element=all_elements_of_category)  # Gets the owner view of a given Revit element (if possible)
