# Dynamo graph getTagFromElement.dyn (Dynamo 1.3.2.2480)

select_model_elements = DSModelElementsSelection()  # 1 picked in the model
code_block = CodeBlock(a=select_model_elements) { {a}; }
python_script = Python(IN[0]=code_block)
# ---------- python_script.python (19 lines) ----------
#Author Konstantin Zhukoven @ https://zhukoven.com
#Tested to work with Dynamo 1.3.0+
import clr
clr.AddReference("RevitAPI")
import Autodesk
from Autodesk.Revit.DB import *

clr.AddReference("RevitServices")
import RevitServices
from RevitServices.Persistence import DocumentManager
doc = DocumentManager.Instance.CurrentDBDocument

elements = UnwrapElement(IN[0])
thost = []
for e in elements:
	eid = e.Id
	thost.append(doc.GetElement(e.TaggedLocalElementId))
	
OUT = thost
# ----------------------------------------
taggedElement = Tag.TaggedElement(select_model_elements)
get_tagged_element_id = Custom[Get Tagged Element Id]()  # Retrives an Element Id from input of element tags. For example if wall tags are inputted it will return tagged wall Ids.; unwired: Tags
select_model_elements_2 = DSModelElementsSelection()  # 2 picked in the model
python_script_2 = Python(IN[0]=select_model_elements_2)
# ---------- python_script_2.python (31 lines) ----------
#Author Konstantin Zhukoven @ https://zhukoven.com
#Tested to work with Dynamo 1.3.0+
import clr
clr.AddReference("RevitAPI")
import Autodesk
from Autodesk.Revit.DB import *

clr.AddReference("RevitServices")
import RevitServices
from RevitServices.Persistence import DocumentManager
doc = DocumentManager.Instance.CurrentDBDocument

elements = UnwrapElement(IN[0])
thost = []
	
tags = FilteredElementCollector(doc).OfCategory(BuiltInCategory.OST_StructuralFramingTags).ToElements()
result = []

for e in elements:
	subList = []
	result.append(subList)
	for t in tags:
		try:
			tid = t.Id
			thost = doc.GetElement(t.TaggedLocalElementId)
			if thost.Id == e.Id:
				subList.append(t)	
		except:
			""

OUT = result
# ----------------------------------------
get_actual_elements_from_linked = Custom[Get Actual Elements from Linked Tag Ids]()  # very slow for the elements...; unwired: tagInfoList
select_taggable_elements_not = Custom[Select Taggable Elements Not Tagged in Active View]()  # from the Dynamo Player samples
get_tagged_linked_element_id = Custom[Get Tagged Linked Element Id]()  # unwired: Tags
isTagged = Custom[Element.IsTagged]()  # Checks if all Elements are tagged in the project; unwired: Tags_of_Category, Elements_of_Category
