# Dynamo graph gridIntersections01.dyn (Dynamo 2.0.2.6826)

family_types = FamilyTypes(index=4)
categories = Categories(index=231)
all_elements_of_category = ElementsOfCategory(Category=categories)
curve = Grid.Curve(grid=all_elements_of_category)
direction = Line.Direction(line=curve)
XAxis = Vector.XAxis()
isParallel = Vector.IsParallel(vector=direction, other=XAxis)
filterByBoolMask = List.FilterByBoolMask(list=all_elements_of_category, mask=isParallel)
curve_2 = Grid.Curve(grid=filterByBoolMask.in)
curve_3 = Grid.Curve(grid=filterByBoolMask.out)
intersect = Geometry.Intersect(geometry=curve_2@L1, other=curve_3)
flatten = List.Flatten(list=intersect)
levels = Levels(index=3)
byPointAndLevel = FamilyInstance.ByPointAndLevel(familyType=family_types, point=flatten, level=levels)
name = Element.Name(element=filterByBoolMask.in)
name_2 = Element.Name(element=filterByBoolMask.out)
add = name@L2 + name_2  # lacing=Longest
transpose = List.Transpose(lists=add)
flatten_2 = List.Flatten(list=transpose)
isEmpty = List.IsEmpty(list=intersect@@L2)
flatten_3 = List.Flatten(list=isEmpty)
filterByBoolMask_2 = List.FilterByBoolMask(list=flatten_2, mask=flatten_3)
code_block = CodeBlock(a=byPointAndLevel, b=filterByBoolMask_2.out) { Elements.Element.SetParameterByName(a, "Summary", b); }
