# Dynamo graph gsa8.dyn (Dynamo 2.0.0.3911)

file_path = Filename("C:\Program Files\Oasys\GSA 8.7\Samples\Stair.gwb")
openGsaFile = ReadGsa.Core.OpenGsaFile(file_path)
openGsaFile_2 = ReadGsa.Core.OpenGsaFile(file_path)
code_block = CodeBlock { "GET, NODE"; }
code_block_2 = CodeBlock { 1; }
gwaCommand = ReadGsa.Core.GwaCommand(openGsaFile_2, code_block, code_block_2)
