# Dynamo graph gsa87.dyn (Dynamo 1.3.2.2480)

file_path = Filename("C:\Program Files\Oasys\GSA 8.7\Samples\Steel\Steel_Design_Complex.gwb")
openGsaFile = ReadGsa.Core.OpenGsaFile(file_path)
openGsaFile_2 = ReadGsa.Core.OpenGsaFile(file_path)
code_block = CodeBlock { "all"; }
elements = ReadGsa.GSAElements.Elements(openGsaFile_2, code_block)
nodesFromRefs = ReadGsa.GSANodes.NodesFromRefs(openGsaFile_2, elements.out1)
deconstruct = List.Deconstruct(list=nodesFromRefs.out1, lacing=Longest)
byStartPointEndPoint = Line.ByStartPointEndPoint(startPoint=deconstruct.first, endPoint=deconstruct.rest)
flatten = Flatten()  # unwired: arg0
levels = Levels()
structural_framing_types = StructuralFramingTypes()
beamByCurve = StructuralFraming.BeamByCurve(level=levels, structuralFramingType=structural_framing_types)  # unwired: curve
nodeDisplacements = ReadGsa.Analysis.NodeDisplacements(openGsaFile_2, elements.out1)
code_block_2 = CodeBlock { "C1"; }
string_from_object = FromObject(elements.out0)
code_block_3 = CodeBlock { 0; }
elementStresses = ReadGsa.Analysis.ElementStresses(openGsaFile_2, code_block_2, string_from_object, code_block_3)
code_block_4 = CodeBlock { 0; }
beamAllResults = ReadGsa.Analysis.BeamAllResults(openGsaFile_2, code_block_2, elements.out0, code_block_4, code_block_4)
