# Dynamo graph gwaCommand.dyn (Dynamo 1.3.2.2480)

code_block = CodeBlock { 2..5; }
file_path = Filename("C:\Users\giovanni.brogiolo\Desktop\Gsa1.gwb")
openGsaFile = ReadGsa.Core.OpenGsaFile(file_path)
code_block_2 = CodeBlock { 1..10; }
code_block_3 = CodeBlock { 5..15; }
code_block_4 = CodeBlock(beams=code_block_2, loads=code_block_3) { "LOAD_BEAM_UDL.2, BeamLoad,"+beams+", 1, GLOBAL, NO, Z,"+loads; }
code_block_5 = CodeBlock { null; }
gwaCommand = ReadGsa.Core.GwaCommand(openGsaFile, code_block_4, code_block_5)
openGsaFile_2 = ReadGsa.Core.OpenGsaFile(file_path)
