# Dynamo graph intersect.dyn (Dynamo 1.3.1.1736)

select_model_elements = DSModelElementsSelection()  # 15 picked in the model
getLocation = Element.GetLocation(select_model_elements)
ZAxis = Vector.ZAxis()
boundingBox = Element.BoundingBox(select_model_elements)
maxPoint = BoundingBox.MaxPoint(boundingBox)
deconstructPoint = Geometry.Points.DeconstructPoint(maxPoint)
translate = Geometry.Translate(geometry=getLocation, direction=ZAxis, distance=deconstructPoint.out2)
byStartPointEndPoint = Line.ByStartPointEndPoint(startPoint=getLocation, endPoint=translate)
categories = Categories("Levels")
all_elements_of_category = ElementsOfCategory(categories)
plane = Custom[Level.Plane](level=all_elements_of_category)  # Retrieves the plane of a given level
intersect = Geometry.Intersect(geometry=byStartPointEndPoint, other=plane, lacing=CrossProduct)
flatten = Flatten(intersect@L3)
splitByPoints = Curve.SplitByPoints(curve=byStartPointEndPoint, points=flatten)
length = Curve.Length(splitByPoints)
doesIntersect = Geometry.DoesIntersect(geometry=byStartPointEndPoint, other=plane, lacing=CrossProduct)
