# Dynamo graph linePatterns.dyn (Dynamo 2.0.1.4955)

python_script = Python()  # unwired: IN[0]
# ---------- python_script.python (39 lines) ----------
import clr

clr.AddReference('RevitAPI')
from Autodesk.Revit.DB import *
from Autodesk.Revit.DB.Structure import *

clr.AddReference('RevitAPIUI')
from Autodesk.Revit.UI import *

clr.AddReference('System')
from System.Collections.Generic import List

clr.AddReference('RevitNodes')
import Revit
clr.ImportExtensions(Revit.GeometryConversion)
clr.ImportExtensions(Revit.Elements)

clr.AddReference('RevitServices')
import RevitServices
from RevitServices.Persistence import DocumentManager
from RevitServices.Transactions import TransactionManager

doc = DocumentManager.Instance.CurrentDBDocument
uidoc=DocumentManager.Instance.CurrentUIApplication.ActiveUIDocument

#Preparing input from dynamo to revit
element = UnwrapElement(IN[0])

#Do some action in a Transaction
TransactionManager.Instance.EnsureInTransaction(doc)

TransactionManager.Instance.TransactionTaskDone()

linesCollector = FilteredElementCollector(doc).OfClass(LinePatternElement)

lines = [l for l in linesCollector]


OUT = doc.GetLinePatternElementByName(lines[5].Name)
# ----------------------------------------
sort = List.Sort(list=python_script)
parameters = Element.Parameters(element=python_script)
