# Dynamo graph lineWork.dyn (Dynamo 2.0.1.4955)

select_model_elements = DSModelElementsSelection()  # 1 picked in the model
element_types = ElementTypes(index=141)
all_elements_of_type = ElementsOfType(element_type=element_types)
name = Element.Name(element=all_elements_of_type)
code_block = CodeBlock { "invisible"; }
code_block_2 = CodeBlock { 1; }
contains = String.Contains(str=name, searchFor=code_block, ignoreCase=code_block_2)
filterByBoolMask = List.FilterByBoolMask(list=all_elements_of_type, mask=contains)
byProperties = Revit.Filter.OverrideGraphicSettings.ByProperties(projectionLineColor=filterByBoolMask.in)
overrideInView = Element.OverrideInView(element=select_model_elements, overrides=byProperties)
python_script = Python(IN[0]=select_model_elements)
# ---------- python_script.python (43 lines) ----------
import clr

clr.AddReference('RevitAPI')
from Autodesk.Revit.DB import *
from Autodesk.Revit.DB.Structure import *

clr.AddReference('RevitAPIUI')
from Autodesk.Revit.UI import *

clr.AddReference('System')
from System.Collections.Generic import List

clr.AddReference('RevitNodes')
import Revit
clr.ImportExtensions(Revit.GeometryConversion)
clr.ImportExtensions(Revit.Elements)

clr.AddReference('RevitServices')
import RevitServices
from RevitServices.Persistence import DocumentManager
from RevitServices.Transactions import TransactionManager

doc = DocumentManager.Instance.CurrentDBDocument
uidoc=DocumentManager.Instance.CurrentUIApplication.ActiveUIDocument

#Preparing input from dynamo to revit
element = UnwrapElement(IN[0])

linePatternElements = FilteredElementCollector(doc).OfClass(LinePatternElement)
categories = doc.Settings.Categories;
lineCat = categories.get_Item(BuiltInCategory.OST_Lines);
subcats = lineCat.SubCategories

matchedItem = subcats.get_Item("Wide Lines");

#Do some action in a Transaction
TransactionManager.Instance.EnsureInTransaction(doc)

matchedItem.LineColor = Color(255,0,0);

TransactionManager.Instance.TransactionTaskDone()

OUT = matchedItem, [s.Name for s in subcats]
# ----------------------------------------
element_types_2 = ElementTypes(index=171)
all_elements_of_type_2 = ElementsOfType(element_type=element_types_2)
name_2 = Element.Name(element=all_elements_of_type_2)
code_block_3 = CodeBlock(a=filterByBoolMask.in) { a[0]; }
code_block_4 = CodeBlock(a=all_elements_of_type_2) { a[5]; }
python_script_2 = Python(IN[0]=code_block_3, IN[1]=code_block_4)
# ---------- python_script_2.python (38 lines) ----------
import clr

clr.AddReference('RevitAPI')
from Autodesk.Revit.DB import *
from Autodesk.Revit.DB.Structure import *

clr.AddReference('RevitAPIUI')
from Autodesk.Revit.UI import *

clr.AddReference('System')
from System.Collections.Generic import List

clr.AddReference('RevitNodes')
import Revit
clr.ImportExtensions(Revit.GeometryConversion)
clr.ImportExtensions(Revit.Elements)

clr.AddReference('RevitServices')
import RevitServices
from RevitServices.Persistence import DocumentManager
from RevitServices.Transactions import TransactionManager

doc = DocumentManager.Instance.CurrentDBDocument
uidoc=DocumentManager.Instance.CurrentUIApplication.ActiveUIDocument

graphicStyle = UnwrapElement(IN[0])
linePattern = UnwrapElement(IN[1])
# "Start" the transaction
TransactionManager.Instance.EnsureInTransaction(doc)

cat = graphicStyle.GraphicsStyleCategory
cat.SetLinePatternId(linePattern.Id, GraphicsStyleType.Projection)

# "End" the transaction
TransactionManager.Instance.TransactionTaskDone()


OUT = graphicStyle
# ----------------------------------------
