# Dynamo graph loopExcel.dyn (Dynamo 2.0.0.3911)

file_path = Filename("C:\Users\giovanni.brogiolo\Desktop\Verifiche.xls")
string = StringInput("1. Verifica BM")
code_block = CodeBlock { 9; 15; }
code_block_2 = CodeBlock { 200..800..100; }
boolean = BoolSelector(true)
code_block_3 = CodeBlock { 1; }
step = Core.Counter.Step(boolean, code_block_3)
count = Core.Counter.Count(step)
getItemAtIndex = List.GetItemAtIndex(list=code_block_2, index=count)
boolean_2 = BoolSelector(false)
writeToFile = Excel.WriteToFile(filePath=file_path, sheetName=string, startRow=code_block.out0, startCol=code_block.out1, data=getItemAtIndex, overWrite=boolean_2)
code_block_4 = CodeBlock { 700; }
file_path_2 = Filename("..\Desktop\results.txt")
fromPath = FileObject(file_path)  # "File.FromPath"
string_2 = StringInput("1. Verifica BM")
boolean_3 = BoolSelector(true)
readFromFile = Excel.ReadFromFile(file=fromPath, sheetName=string_2, readAsStrings=boolean_3)
removeNulls = Lists.Manage.RemoveNulls(readFromFile)
code_block_5 = CodeBlock(result=removeNulls) { result[27][6]; }
code_block_6 = CodeBlock(a=getItemAtIndex, b=code_block_5) { "Design Moment="+a+"     Result="+b; }
writeText = File.WriteText(file_path_2, code_block_6)
