# Dynamo graph measureExecutionTime.dyn (Dynamo 1.3.1.1736)

python_script = Python()  # unwired: IN[0]
# ---------- python_script.python (14 lines) ----------
import clr
clr.AddReference('ProtoGeometry')
from Autodesk.DesignScript.Geometry import *

import sys
sys.path.append("C:\Program Files (x86)\IronPython 2.7\Lib")

import timeit

list = []
t = timeit.Timer("print 'main statement'", "print 'setup'")


OUT = t.timeit(3)
# ----------------------------------------
python_script_2 = Python()  # unwired: IN[0]
# ---------- python_script_2.python (22 lines) ----------
import clr
clr.AddReference('ProtoGeometry')
from Autodesk.DesignScript.Geometry import *

import sys
sys.path.append("C:\Program Files (x86)\IronPython 2.7\Lib")

import timeit
 
# code snippet to be executed only once
mysetup = "from math import sqrt"
 
# code snippet whose execution time is to be measured
mycode = """
def example():
    mylist = []
    for x in range(100):
        mylist.append(sqrt(x))
"""
 
# timeit statement
OUT = timeit.timeit(setup = mysetup, stmt = mycode, number = 10000)
# ----------------------------------------
python_script_3 = Python()  # unwired: IN[0]
# ---------- python_script_3.python (19 lines) ----------
import clr
clr.AddReference('ProtoGeometry')
from Autodesk.DesignScript.Geometry import *

import sys
sys.path.append("C:\Program Files (x86)\IronPython 2.7\Lib")

import timeit
 
# code snippet to be executed only once
mysetup = "from math import sqrt"
 
# code snippet whose execution time is to be measured
mycode = """
myList = list()
"""
 
# timeit statement
OUT = timeit.timeit(setup = mysetup, stmt = mycode, number = 10000)*1000
# ----------------------------------------
python_script_4 = Python()  # unwired: IN[0]
# ---------- python_script_4.python (19 lines) ----------
import clr
clr.AddReference('ProtoGeometry')
from Autodesk.DesignScript.Geometry import *

import sys
sys.path.append("C:\Program Files (x86)\IronPython 2.7\Lib")

import timeit
 
# code snippet to be executed only once
mysetup = "from math import sqrt"
 
# code snippet whose execution time is to be measured
mycode = """
myList = []
"""
 
# timeit statement
OUT = timeit.timeit(setup = mysetup, stmt = mycode, number = 10000)*1000
# ----------------------------------------
