# Dynamo graph modelessForm01.dyn (Dynamo 2.0.1.5055)

select_model_elements = DSModelElementsSelection()  # 3 picked in the model

# group: Get Identity_Type Mark
string = StringInput("Identity_Type Mark")
get_type_parameter = Custom[Get Type Parameter](element=select_model_elements, parameterName=string)
string_from_object = FromObject(obj=get_type_parameter)
watch = Watch(string_from_object)

# group: Obtain Element ID
id = Element.Id(element=select_model_elements)
string_from_object_2 = FromObject(obj=id)

unique_beam_id = Watch(string_from_object_2)
code_block = CodeBlock { 1; }
chop = List.Chop(list=unique_beam_id, lengths=code_block)

# group: Determine Beam size
string_2 = StringInput("Type")
getParameterValueByName = Element.GetParameterValueByName(element=select_model_elements, parameterName=string_2)
string_from_object_3 = FromObject(obj=getParameterValueByName)
code_block_2 = CodeBlock { 13; }
code_block_3 = CodeBlock { 25; }
substring = String.Substring(str=string_from_object_3, startIndex=code_block_2, length=code_block_3)
string_3 = StringInput(",")
split = String.Split(str=substring, separater0=string_3)
code_block_4 = CodeBlock { 0; }
getItemAtIndex = List.GetItemAtIndex(list=split, index=code_block_4, lacing=Longest)

beam_sizes = Watch(getItemAtIndex)
code_block_5 = CodeBlock { 1; }
chop_2 = List.Chop(list=beam_sizes, lengths=code_block_5)

# group: Interrogate beam parameters and returns text string level
string_4 = StringInput("Reference Level")
getParameterValueByName_2 = Element.GetParameterValueByName(element=select_model_elements, parameterName=string_4)
string_from_object_4 = FromObject(obj=getParameterValueByName_2)
code_block_6 = CodeBlock { 17; }
code_block_7 = CodeBlock { 2; }
substring_2 = String.Substring(str=string_from_object_4, startIndex=code_block_6, length=code_block_7)

levels = Watch(substring_2)
code_block_8 = CodeBlock { 1; }
chop_3 = List.Chop(list=levels, lengths=code_block_8)

# group: Define PB or SB
string_5 = StringInput("Structural Usage")
getParameterValueByName_3 = Element.GetParameterValueByName(element=select_model_elements, parameterName=string_5)
watch_2 = Watch(getParameterValueByName_3)
code_block_9 = CodeBlock { 4; }
lt = watch_2 < code_block_9
string_from_object_5 = FromObject(obj=lt)
string_6 = StringInput("false")
string_7 = StringInput("SB")
replace = String.Replace(str=string_from_object_5, searchFor=string_6, replaceWith=string_7)
string_8 = StringInput("true")
string_9 = StringInput("PB")
replace_2 = String.Replace(str=replace, searchFor=string_8, replaceWith=string_9)

pb_or_sb = Watch(replace_2)
code_block_10 = CodeBlock { 1; }
chop_4 = List.Chop(list=pb_or_sb, lengths=code_block_10)

# group: Find Beam Centre points
getLocation = Element.GetLocation(element=select_model_elements)
code_block_11 = CodeBlock { 0.5; }
pointAtParameter = Curve.PointAtParameter(curve=getLocation, param=code_block_11)
X = Point.X(point=pointAtParameter)
Y = Point.Y(point=pointAtParameter)

# group: Coordinates at Grid A-01
code_block_12 = CodeBlock { -67286.598; }
code_block_13 = CodeBlock { 559.835; }

# group: distance from base point to beam CL's
sub = X - code_block_12
code_block_14 = CodeBlock { 1000; }
div = sub / code_block_14
sub_2 = Y - code_block_13
code_block_15 = CodeBlock { 1000; }
div_2 = sub_2 / code_block_15

x_coordinates = Watch(div)
abs = Math.Abs(number=x_coordinates)
code_block_16 = CodeBlock { 5; }
round = Math.Round(number=abs, digits=code_block_16)
code_block_17 = CodeBlock { 1; }
chop_5 = List.Chop(list=round, lengths=code_block_17)
y_coordinates = Watch(div_2)
round_2 = Math.Round(number=y_coordinates, digits=code_block_16)
code_block_18 = CodeBlock { 1; }
chop_6 = List.Chop(list=round_2, lengths=code_block_18)
list_create = List.Create(item0=chop, item1=chop_2, item2=chop_3, item3=chop_4, item4=chop_5, item5=chop_6)

# group: Write to Excel
file_path = Filename(".\CQT Beam Schedule.xlsx")
string_10 = StringInput("Sheet1")
code_block_19 = CodeBlock { 2; }
code_block_20 = CodeBlock { [0..5]; }
transpose = List.Transpose(lists=code_block_20)
exportExcel = Data.ExportExcel(filePath=file_path, sheetName=string_10, startRow=code_block_19, startCol=transpose, data=list_create)  # frozen

# group: For Upper Ground Only Replaces Gr with UG
string_11 = StringInput("Gr")
string_12 = StringInput("UG")
replace_3 = String.Replace(str=substring_2, searchFor=string_11, replaceWith=string_12)

current = Document.Current()
activeView = Document.ActiveView(document=current)
watch_3 = Watch(activeView)

# group: For L5 mezz Only Replaces 05 with 05M
string_13 = StringInput("05")
string_14 = StringInput("05M")
replace_4 = String.Replace(str=substring_2, searchFor=string_13, replaceWith=string_14)

code_block_21 = CodeBlock { 0; }

# group: TURNS "1" INTO "01"
round_3 = Math.Round(number=abs, digits=code_block_21)
string_from_object_6 = FromObject(obj=round_3)
string_15 = StringInput(".")
split_2 = String.Split(str=string_from_object_6, separater0=string_15)
code_block_22 = CodeBlock { 0; }
getItemAtIndex_2 = List.GetItemAtIndex(list=split_2, index=code_block_22, lacing=Longest)
code_block_23 = CodeBlock { 2; }
string_16 = StringInput("0")
padLeft = String.PadLeft(str=getItemAtIndex_2, newWidth=code_block_23, padChars=string_16)

# group: TURNS "1" INTO "01"
round_4 = Math.Round(number=y_coordinates, digits=code_block_21)
string_from_object_7 = FromObject(obj=round_4)
string_17 = StringInput(".")
split_3 = String.Split(str=string_from_object_7, separater0=string_17)
code_block_24 = CodeBlock { 0; }
getItemAtIndex_3 = List.GetItemAtIndex(list=split_3, index=code_block_24, lacing=Longest)
code_block_25 = CodeBlock { 2; }
string_18 = StringInput("0")
padLeft_2 = String.PadLeft(str=getItemAtIndex_3, newWidth=code_block_25, padChars=string_18)

list_create_2 = List.Create(item0=levels, item1=pb_or_sb, item2=padLeft, item3=padLeft_2)
transpose_2 = List.Transpose(lists=list_create_2)
concat = String.Concat(string0=transpose_2)
watch_4 = Watch(concat)
flatten = List.Flatten(list=watch_4)
string_19 = StringInput("Mark")

# group: original
getParameterValueByName_4 = Element.GetParameterValueByName(element=select_model_elements, parameterName=string_19)

python_script = Python(IN[0]=flatten, IN[1]=getParameterValueByName_4, IN[2]=select_model_elements)
# ---------- python_script.python (21 lines) ----------
existing = IN[1]
new = IN[0]
elements = IN[2]

notChanged = []
changed = []
newers = []


for i in range(0,len(elements)):
	if existing[i] == new[i]:
		notChanged.append(elements[i])
	elif existing[i] == "":
		newers.append(elements[i])
	else:
		changed.append(elements[i])



# Assign your output to the OUT variable.
OUT = notChanged, changed, newers
# ----------------------------------------
code_block_26 = CodeBlock(a=python_script) { a[0]; }
code_block_27 = CodeBlock { color1 = Color.ByARGB(255, 0, 255, 0); color2 = Color.ByARGB(255, 255, 255, 0); color3 = Color.ByARGB(255, 255, 0, 0); }

# group: Not changed
overrideColorInView = Element.OverrideColorInView(element=code_block_26, color=code_block_27.color1)

python_script_2 = Python()  # frozen; unwired: IN[0]
# ---------- python_script_2.python (57 lines) ----------
import clr

clr.AddReference('RevitAPI')
from Autodesk.Revit.DB import *
from Autodesk.Revit.DB.Structure import *


clr.AddReference('RevitAPIUI')
from Autodesk.Revit.UI import *
from Autodesk.Revit.UI.Selection import *


clr.AddReference('System')
from System.Collections.Generic import List

clr.AddReference('RevitNodes')
import Revit
clr.ImportExtensions(Revit.GeometryConversion)
clr.ImportExtensions(Revit.Elements)

clr.AddReference('RevitServices')
import RevitServices
from RevitServices.Persistence import DocumentManager
from RevitServices.Transactions import TransactionManager

import math
from System.Collections.Generic import Dictionary,List

doc = DocumentManager.Instance.CurrentDBDocument
uidoc=DocumentManager.Instance.CurrentUIApplication.ActiveUIDocument


class CustomISelectionFilter(ISelectionFilter):
	def __init__(self, nom_categorie):
		self.nom_categorie = nom_categorie
	def AllowElement(self, e):
		if e.Category.Name == self.nom_categorie:
			return True
		else:
			return False
	def AllowReference(self, ref, point):
		return true


mainDialog = TaskDialog("Hello, Revit!");
mainDialog.MainInstruction = "Hello, Revit!";
mainDialog.MainContent = "This sample shows how to use a Revit task dialog to communicate with the user."

mainDialog.CommonButtons = TaskDialogCommonButtons.Close | TaskDialogCommonButtons.Ok;
mainDialog.DefaultButton = TaskDialogResult.Close;

mainDialog.Show()




OUT = TaskDialogResult == TaskDialogResult.Close
# ----------------------------------------
boolean = BoolSelector(true)
python_script_3 = Python(IN[0]=boolean)  # frozen
# ---------- python_script_3.python (92 lines) ----------
import clr

clr.AddReference("System.Windows.Forms")
from System.Windows.Forms import Application, Button, Form, Label, TextBox, CheckBox, FolderBrowserDialog, OpenFileDialog, DialogResult, ComboBox, FormBorderStyle, FormStartPosition

clr.AddReference("System.Drawing")
from System.Drawing import *

clr.AddReference("System")
from System import EventHandler


clr.AddReference("RevitAPIUI")
from Autodesk.Revit.UI import IExternalEventHandler, ExternalEvent

clr.AddReference("RevitAPI")
from Autodesk.Revit.DB import Transaction
# noinspection PyUnresolvedReferences
from Autodesk.Revit.Exceptions import InvalidOperationException


button1 = Button();
button2 = Button();
label1 = Label();

form = Form()

result= 0

def update():
	global result 
	result += 1

OUT = []

def output():
	return OUT.append("ciao")

def Close():
	form.Close()

def Button1Click(sender, e):
	output()
	return update()	
	
def Button2Click(sender, e):
	global result
	result -= 1


button1.DialogResult = DialogResult.OK;
button1.Location = Point(10, 75);
button1.Name = "button1";
button1.Size = Size(88, 32);
button1.TabIndex = 0;
button1.Text = "OK";
button1.UseCompatibleTextRendering = True;
button1.UseVisualStyleBackColor = True;
button1.Click += EventHandler(Button1Click);

button2.DialogResult = DialogResult.Cancel;
button2.Location = Point(134, 75);
button2.Name = "button2";
button2.Size = Size(88, 32);
button2.TabIndex = 1;
button2.Text = "Cancel";
button2.UseCompatibleTextRendering = True;
button2.UseVisualStyleBackColor = True;
button2.Click += EventHandler(Button2Click);
# 
# label1
# 
label1.Location = Point(12, 9);
label1.Name = "label1";
label1.Size = Size(219, 63);
label1.TabIndex = 2;
label1.Text = "You are updating the beam tags. Click OK to accept the changes or Cancel to discard them";
label1.UseCompatibleTextRendering = True;
# 
# Form1
# 
ClientSize = Size(251, 126);
form.Controls.Add(label1);
form.Controls.Add(button2);
form.Controls.Add(button1);
Name = "Form1";
Text = "User input required";
form.StartPosition = FormStartPosition.CenterScreen

	
	
form.Show()
# ----------------------------------------
python_script_4 = Python(IN[0]=boolean)  # frozen
# ---------- python_script_4.python (16 lines) ----------
import clr

clr.AddReference("System.Windows.Forms")
from System.Windows.Forms import Application, Button, Form, Label, TextBox, CheckBox, FolderBrowserDialog, OpenFileDialog, DialogResult, ComboBox, FormBorderStyle, FormStartPosition, MessageBox, MessageBoxButtons, MessageBoxIcon

clr.AddReference("System.Drawing")
from System.Drawing import *

clr.AddReference("System")
from System import EventHandler


if (MessageBox.Show("Are you sure you want to change the model?", "Add", MessageBoxButtons.YesNo, MessageBoxIcon.Question) == DialogResult.Yes):                
	OUT = True
else:
	OUT = False
# ----------------------------------------
python_script_5 = Python()  # unwired: IN[0]
# ---------- python_script_5.python (1429 lines) ----------
#Copyright (c) Data Shapes,  2018
#Data-Shapes www.data-shapes.net , elayoubi.mostafa@data-shapes.io @data_shapes

import clr
import sys
pyt_path = r'C:\Program Files (x86)\IronPython 2.7\Lib'
sys.path.append(pyt_path)
import os
import webbrowser
import unicodedata

try:
clr.AddReference('System.Windows.Forms')
clr.AddReference('System.Drawing')
clr.AddReference('System.Windows.Forms.DataVisualization')

from System.Drawing import Point , Size , Graphics, Bitmap, Image, Font, FontStyle, Icon, Color, Region , Rectangle , ContentAlignment
from System.Windows.Forms import Application, DockStyle, Button, Form, Label, TrackBar , ToolTip, ColumnHeader, TextBox, CheckBox, FolderBrowserDialog, OpenFileDialog, DialogResult, ComboBox, FormBorderStyle, FormStartPosition, ListView, ListViewItem , SortOrder, Panel, ImageLayout, GroupBox, RadioButton, BorderStyle, PictureBox, PictureBoxSizeMode, LinkLabel, CheckState, ColumnHeaderStyle , ImageList, VScrollBar, DataGridView, DataGridViewSelectionMode, DataGridViewAutoSizeColumnsMode , DataGridViewClipboardCopyMode , TreeView , TreeNode , TreeNodeCollection
from System.Windows.Forms.DataVisualization.Charting import Chart , SeriesChartType
from System.Collections.Generic import *
from System.Collections.Generic import List as iList
from System.Windows.Forms import View as vi
clr.AddReference('System')
from System import IntPtr , Char
from System import Type as SType
from System.ComponentModel import Container
clr.AddReference('System.Data')
from System.Data import DataTable , DataView


clr.AddReference('RevitAPIUI')
from  Autodesk.Revit.UI import Selection , TaskDialog 
from  Autodesk.Revit.UI.Selection import ISelectionFilter

importcolorselection = 0

try:
	from  Autodesk.Revit.UI import ColorSelectionDialog
except:
	importcolorselection = 1

clr.AddReference('RevitNodes')
import Revit
clr.ImportExtensions(Revit.Elements)
clr.ImportExtensions(Revit.GeometryConversion)

clr.AddReference('RevitServices')
from RevitServices.Persistence import DocumentManager
doc = DocumentManager.Instance.CurrentDBDocument
uidoc = DocumentManager.Instance.CurrentUIApplication.ActiveUIDocument

clr.AddReference('RevitAPI')
from Autodesk.Revit.DB import FilteredElementCollector , View , ViewType , ElementId , FamilyInstance , Document , UnitType , UnitUtils
dbviews = [v for v in FilteredElementCollector(doc).OfClass(View).ToElements() if (v.ViewType == ViewType.FloorPlan or v.ViewType == ViewType.CeilingPlan or v.ViewType == ViewType.Section or v.ViewType == ViewType.Elevation or v.ViewType == ViewType.ThreeD)]
viewindex = 0

clr.AddReference('ProtoGeometry')
from Autodesk.DesignScript.Geometry import Point as dsPoint

from System.Reflection import Assembly
import xml.etree.ElementTree as et

UIunit = Document.GetUnits(doc).GetFormatOptions(UnitType.UT_Length).DisplayUnits

import re	
def regexEndNum(input):
	try:
		return 	re.search('(\d+)$', input).group(0)
	except:
		return ""

class MultiTextBoxForm(Form):
	
    def __init__(self):
        self.Text = 'Data-Shapes | Multi Input UI ++'
        self.output = []
        self.values = []
        self.cancelled = False

    def setclose(self, sender, event):
    	cbindexread = 0
    	if sender.Name != "Cancel":
    		for f in self.output:
    			if f.GetType() == myTextBox:
    				if f._isNum :
    					val = float(f.Text)
    				else:
    					val = f.Text
    				self.values.append(val)
    			if f.GetType() == CheckBox:
    				self.values.append(f.Checked)
    			if f.GetType() == Button:
    				if isinstance(f.Tag ,list):
    					self.values.append([e for e in f.Tag if e.__class__.__name__ != "Category"])
    				else:	    					
    					if f.Tag.__class__.__name__ != "Category":
    						self.values.append(f.Tag)
    					else:
							self.values.append([])

    			if f.GetType() == ComboBox:
    				try:
    					key = f.Text
    					self.values.append(f.Tag[key])
    				except:
    					self.values.append(None)
    			if f.GetType() == mylistview:
    				self.values.append([f.Values[i.Text] for i in f.CheckedItems])
    			if f.GetType() == mytrackbar:
    				self.values.append(f.startval+f.Value*f.step)
    			if f.GetType() == mygroupbox:
    				try:
    					key = [j.Text for j in f.Controls if j.Checked == True][0]
    					self.values.append(f.Tag[key])
    				except:
    					self.values.append(None)
    			if f.GetType() == myDataGridView:
    				f.EndEdit()
    				dsrc = f.DataSource
    				out = []
    				colcount = f.ColumnCount
    				rowcount = f.RowCount - 1
    				if f.Tag:
	    				l = []
    					for i in range(colcount):	    						
    						l.append(dsrc.Columns[i].ColumnName)
    					out.append(l)	    						
	    				for r in range(rowcount):
	    					l = []
	    					for i in range(colcount):
	    						l.append(dsrc.DefaultView[r].Row[i])
	    					out.append(l)
    				else: 
	    				for r in range(rowcount):
	    					l = []
	    					for i in range(colcount):
	    						l.append(dsrc.DefaultView[r].Row[i])
	    					out.append(l)
    				self.values.append(out)
    			if f.GetType() == TreeView:
    				ls = []
    				nds = f.Nodes[0]
    				iterateThroughNodes(nds,ls)
    				self.values.append(ls)	 
    	else:
    		self.values = None
    		self.cancelled = True
    	self.Close()

    def reset(self, sender, event):
		pass

    def openfile(self, sender, event):
		ofd = OpenFileDialog()
		dr = ofd.ShowDialog()
		if dr == DialogResult.OK:
			sender.Text = ofd.FileName
			sender.Tag = ofd.FileName

    def exportToExcel(self, sender, event):
    	#importing Excel IronPython libraries
    	clr.AddReferenceByName('Microsoft.Office.Interop.Excel, Version=11.0.0.0, Culture=neutral, PublicKeyToken=71e9bce111e9429c')
    	from Microsoft.Office.Interop import Excel
    	ex = Excel.ApplicationClass()
    	ex.Visible = sender.Tag[1]
    	ex.DisplayAlerts = False
    	fbd = FolderBrowserDialog()
    	fbd.SelectedPath = sender.Text
    	parent = sender.Parent
    	fptextbox = parent.GetChildAtPoint(Point(parent.Location.X,sender.Location.Y+5))
    	dataGrid = parent.GetChildAtPoint(Point(parent.Location.X,parent.Location.Y+23))
    	dataTable = dataGrid.DataSource
    	fptext = fptextbox.Text
    	titletext = parent.GetChildAtPoint(Point(0,0)).Text
    	dr = fbd.ShowDialog()
    	frstRwTtle = sender.Tag[0]
    	if frstRwTtle:
    		_header = Excel.XlYesNoGuess.xlYes
    	else:
    		_header = Excel.XlYesNoGuess.xlNo
    	if dr == DialogResult.OK:
    		workbk = ex.Workbooks.Add()
    		worksheet = workbk.Worksheets.Add()
    		#Writing title and doc info
    		if sender.Tag[2]:
	    		titleCell = worksheet.Cells[1,1]
	    		worksheet.Cells[2,1].Value2 = sender.Tag[3]
	    		titleCell.Value2 = titletext
	    		titleCell.Font.Size = 18
	    		titleCell.Font.Bold = True
	    		startR = 3
	    		endR = 3
	    	else:
	    		startR = 1
	    		endR = 0	
	    	if frstRwTtle:
	    		for j in range(0,dataTable.Columns.Count):
	    			worksheet.Cells[startR,j+1] = dataTable.Columns[j].ColumnName		    	
	    		for i in range(0,dataTable.Rows.Count):
	    			for j in range(0,dataTable.Columns.Count):
		    			worksheet.Cells[i+startR+1,j+1] = dataTable.DefaultView[i].Row[j].ToString()
	    		xlrange = ex.get_Range(worksheet.Cells[startR,1],worksheet.Cells[dataTable.Rows.Count+endR+1,dataTable.Columns.Count])			    			
	    	else :
	    		for i in range(0,dataTable.Rows.Count):
	    			for j in range(0,dataTable.Columns.Count):
		    			worksheet.Cells[i+startR,j+1] = dataTable.DefaultView[i].Row[j].ToString()		    	
	    		xlrange = ex.get_Range(worksheet.Cells[startR,1],worksheet.Cells[dataTable.Rows.Count+endR,dataTable.Columns.Count])
	    	xlrange.Columns.AutoFit()
	    	worksheet.ListObjects.Add(Excel.XlListObjectSourceType.xlSrcRange, xlrange, SType.Missing, _header, SType.Missing).Name = "DataShapesTable"
	    	worksheet.ListObjects["DataShapesTable"].TableStyle =  "TableStyleMedium16"
    		workbk.SaveAs(fbd.SelectedPath + "\\" + fptext)
    		if not sender.Tag[1]:
    			workbk.Close()
    			ex.Quit()

    def startCell(self, sender, event ):
		sender.startcell["X"] = event.ColumnIndex
		sender.startcell["Y"] = event.RowIndex	

    def endCell(self, sender, event ):
    	try:
			sender.endcell["X"] = event.ColumnIndex
			sender.endcell["Y"] = event.RowIndex 
			startval = sender.Rows[sender.startcell["Y"]].Cells[sender.startcell["X"]].Value
			endNum = regexEndNum(startval)
			if endNum != "":
				if sender.endcell["Y"] == sender.startcell["Y"]:
					for e,i in enumerate(range(sender.startcell["X"],sender.endcell["X"] + 1)):
						sender.Rows[sender.startcell["Y"]].Cells[i].Value = startval[:-len(endNum)] + str(int(endNum) + e)
				elif sender.endcell["X"] == sender.startcell["X"]:
					for e,i in enumerate(range(sender.startcell["Y"],sender.endcell["Y"] + 1)):
						sender.Rows[i].Cells[sender.endcell["X"]].Value = startval[:-len(endNum)] + str(int(endNum) + e)
			else:				
				if sender.endcell["Y"] == sender.startcell["Y"]:
					for i in range(sender.startcell["X"],sender.endcell["X"] + 1):
						sender.Rows[sender.startcell["Y"]].Cells[i].Value = startval
				elif sender.endcell["X"] == sender.startcell["X"]:
					for i in range(sender.startcell["Y"],sender.endcell["Y"] + 1):
						sender.Rows[i].Cells[sender.endcell["X"]].Value = startval
    	except:
    		pass
    		    	
    def startRowDrag(self, sender, event ):
    	shmak
		
    def opendirectory(self, sender, event):
		fbd = FolderBrowserDialog()
		fbd.SelectedPath = sender.Text
		dr = fbd.ShowDialog()
		if dr == DialogResult.OK:
			sender.Text = fbd.SelectedPath
			sender.Tag = fbd.SelectedPath

    def pickobjects(self, sender, event):
		for c in self.Controls:
			c.Enabled = False
		try:
			sel = uidoc.Selection.PickObjects(Selection.ObjectType.Element,'')
			selelem = [doc.GetElement(s.ElementId) for s in sel]
			sender.Tag = (selelem)
		except:
			pass
		for c in self.Controls:
			c.Enabled = True
    def pickobjectsordered(self, sender, event):
		for c in self.Controls:
			c.Enabled = False
		output = []
		test = True
		TaskDialog.Show("Data|Shapes", 'Pick elements in order, then hit ESC to exit.')
		while test:
			try:
				sel = doc.GetElement(uidoc.Selection.PickObject(Selection.ObjectType.Element, 'Pick elements in order').ElementId)
				output.append(sel.ToDSType(True))
			except : 
				test = False
			sender.Tag = output
		for c in self.Controls:
			c.Enabled = True
    
    def pickobjectsofcatordered(self, sender, event):
		for c in self.Controls:
			c.Enabled = False
		output = []
		test = True
		if isinstance(sender.Tag,list):			
			category = UnwrapElement(sender.Tag)
		else:
			category = [UnwrapElement(sender.Tag)]
		TaskDialog.Show("Data|Shapes", 'Select %s in order, then press ESC to exit.' %(', '.join([c.Name for c in category])))
		while test:
			try:
				selfilt = selectionfilter(category)
				sel = doc.GetElement(uidoc.Selection.PickObject(Selection.ObjectType.Element,selfilt, 'Select %s' %(', '.join([c.Name for c in category]))).ElementId)				
				output.append(sel.ToDSType(True))
			except : 
				test = False
			sender.Tag = (output)
		for c in self.Controls:
			c.Enabled = True
		
    def picklinkedobjects(self, sender, event):
		#This part was made easier by Dimitar Venkov's work
		for c in self.Controls:
			c.Enabled = False
		try:
			linkref = uidoc.Selection.PickObject(Selection.ObjectType.Element,'Select the link instance.')
			link = doc.GetElement(linkref.ElementId).GetLinkDocument()
			td = TaskDialog.Show('Data-Shapes','Select the linked elements and press Finish.')
			sel = uidoc.Selection.PickObjects(Selection.ObjectType.LinkedElement,'Select the linked elements and press Finish.')
			selelem = [link.GetElement(s.LinkedElementId) for s in sel]
			sender.Tag = (selelem)
		except:
			pass
		for c in self.Controls:
			c.Enabled = True		

    def pickobject(self, sender, event):
		for c in self.Controls:
			c.Enabled = False
		try:
			sel = uidoc.Selection.PickObject(Selection.ObjectType.Element,'')
			selelem = doc.GetElement(sel.ElementId) 
			sender.Tag = (selelem)
		except:
			pass
		for c in self.Controls:
			c.Enabled = True
		
    def picklinkedobject(self, sender, event):
		#This part was made easier by Dimitar Venkov's work
		for c in self.Controls:
			c.Enabled = False
		try:
			linkref = uidoc.Selection.PickObject(Selection.ObjectType.Element,'Select the link instance.')
			link = doc.GetElement(linkref.ElementId).GetLinkDocument()
			td = TaskDialog.Show('Data-Shapes','Select the linked element.')
			sel = uidoc.Selection.PickObject(Selection.ObjectType.LinkedElement,'Select the linked element.')
			selelem = link.GetElement(sel.LinkedElementId)
			sender.Tag = (selelem)
		except:
			pass				
		for c in self.Controls:
			c.Enabled = True
		
    def pickobjectsofcat(self, sender, event):
		for c in self.Controls:
			c.Enabled = False
		if isinstance(sender.Tag,list):	    
			category = UnwrapElement(sender.Tag)
		else:
			category = [UnwrapElement(sender.Tag)]
		try:
			selfilt = selectionfilter(category)
			sel = uidoc.Selection.PickObjects(Selection.ObjectType.Element,selfilt,'Select %s' %(', '.join([c.Name for c in category])))
			selelem = [doc.GetElement(s.ElementId) for s in sel]
			sender.Tag = (selelem)
		except:
			pass
		for c in self.Controls:
			c.Enabled = True

    def pickobjectofcat(self, sender, event):
		for c in self.Controls:
			c.Enabled = False
		if isinstance(sender.Tag,list):	    
			category = UnwrapElement(sender.Tag)
		else:
			category = [UnwrapElement(sender.Tag)]
		try:
			selfilt = selectionfilter(category)
			sel = uidoc.Selection.PickObject(Selection.ObjectType.Element,selfilt,'Select %s' %(', '.join([c.Name for c in category])))
			selelem = doc.GetElement(sel.ElementId) 
			sender.Tag = (selelem)
		except:
			pass
		for c in self.Controls:
			c.Enabled = True
		
    def pickfaces(self, sender, event):
		faces = []	    	
		for c in self.Controls:
			c.Enabled = False
		try:
			selface = uidoc.Selection.PickObjects(Selection.ObjectType.Face,'')
			for s in selface:
				f = uidoc.Document.GetElement(s).GetGeometryObjectFromReference(s).ToProtoType(True)
				[i.Tags.AddTag("RevitFaceReference", s) for i in f]
				faces.append(f)
			sender.Tag = [i for j in faces for i in j]
		except:
			pass
		for c in self.Controls:
			c.Enabled = True
			
    def pickpointsonface(self, sender, event):
		faces = []	    	
		for c in self.Controls:
			c.Enabled = False
		selpoints = uidoc.Selection.PickObjects(Selection.ObjectType.PointOnElement,'')
		points = []
		for s in selpoints:
			pt = s.GlobalPoint
			points.append(dsPoint.ByCoordinates(UnitUtils.ConvertFromInternalUnits(pt.X,UIunit),UnitUtils.ConvertFromInternalUnits(pt.Y,UIunit),UnitUtils.ConvertFromInternalUnits(pt.Z,UIunit)))
		sender.Tag = points
		for c in self.Controls:
			c.Enabled = True
			
    def pickedges(self, sender, event):
		edges = []
		for c in self.Controls:
			c.Enabled = False	
		try:				
			seledge = uidoc.Selection.PickObjects(Selection.ObjectType.Edge,'')
			for s in seledge:
				e = uidoc.Document.GetElement(s).GetGeometryObjectFromReference(s).AsCurve().ToProtoType(True)
				e.Tags.AddTag("RevitFaceReference", s)
				edges.append(e)
			sender.Tag = edges
		except:
			pass
		for c in self.Controls:
			c.Enabled = True

    def colorpicker(self, sender, event):
		dialog = ColorSelectionDialog()
		selection = ColorSelectionDialog.Show(dialog)
		selected = dialog.SelectedColor
		sender.Tag = selected
		sender.BackColor = Color.FromArgb(selected.Red,selected.Green,selected.Blue)
		sender.ForeColor = Color.FromArgb(selected.Red,selected.Green,selected.Blue)

    def topmost(self):
		self.TopMost = True

    def lvadd(self, sender, event):
		sender.Tag = [i for i in sender.CheckedItems]
		
    def scroll(self, sender, event):
		parent = sender.Parent
		child = parent.GetChildAtPoint(Point(0,5))
		child.Text = str(sender.startval+sender.Value*sender.step)

    def openurl(self, sender, event):
		webbrowser.open(sender.Tag)

    def selectall(self, sender, event):
		if sender.Checked:
			parent = sender.Parent
			listview = parent.GetChildAtPoint(Point(0,0))
			for i in listview.Items:
				i.Checked = True
		else:
			pass
			
    def selectnone(self, sender, event):
		if sender.Checked:
			parent = sender.Parent
			listview = parent.GetChildAtPoint(Point(0,0))
			for i in listview.Items:
				i.Checked = False
		else:
			pass		

    def updateallnone(self, sender, event):
    	try:
    		parent = sender.Parent
    		rball = parent.GetChildAtPoint(Point(0,sender.Height + 5))
    		rbnone = parent.GetChildAtPoint(Point(80,sender.Height + 5))
    		if sender.CheckedItems.Count == 0 and event.NewValue == CheckState.Unchecked:
    			rbnone.Checked = False
    			rball.Checked = False
    		elif sender.CheckedItems.Count == sender.Items.Count and event.NewValue == CheckState.Unchecked:
    			rball.Checked = False
    			rbnone.Checked = False
    		elif sender.CheckedItems.Count == sender.Items.Count-1 and event.NewValue == CheckState.Checked:
    			rball.Checked = True
    			rbnone.Checked = False
    		elif sender.CheckedItems.Count == 1 and event.NewValue == CheckState.Unchecked:
    			rball.Checked = False
    			rbnone.Checked = True	    	
    		else :
    			rball.Checked = False
    			rbnone.Checked = False
    	except:
    		pass

    def zoomcenter(self, sender, event ):
		if event.X > 15:	    
			try:
				uiviews = uidoc.GetOpenUIViews()
				element = doc.GetElement(uidoc.Selection.GetElementIds()[0])
				activeview = doc.ActiveView
				bbox = element.get_BoundingBox(activeview)	
				activeuiview = [v for v in uiviews if v.ViewId == activeview.Id][0]
				activeuiview.ZoomAndCenterRectangle(bbox.Min, bbox.Max)
				uidoc.RefreshActiveView()
			except:
				pass
		else:
			pass
			
		
    def setviewforelement(self, sender, event ):    
		if event.X > 15:	    		
			try:
				item = sender.GetItemAt(event.X,event.Y).Text
				element = UnwrapElement(sender.Values[item])
				try:
					viewsforelement = [v for v in dbviews if (not v.IsTemplate) and (element.Id in [e.Id for e in FilteredElementCollector(doc,v.Id).OfClass(element.__class__).ToElements()])]
				except:
					viewsforelement = [v for v in dbviews if (not v.IsTemplate) and (element.Id in [e.Id for e in FilteredElementCollector(doc,v.Id).OfClass(FamilyInstance).ToElements()])]
				global viewindex
				dbView = viewsforelement[viewindex]
				id = [element.Id]
				icollection = iList[ElementId](id)
				uidoc.Selection.SetElementIds(icollection)
				if (viewindex >= len(viewsforelement) -1) or not (element.Id in uidoc.Selection.GetElementIds()):
					viewindex = 0
				else:
					viewindex += 1
				uidoc.RequestViewChange(dbView)
			except:
				pass
		else:	    
			pass

    def CheckChildren(self, sender, event ):
		evNode = event.Node	    
		checkState = evNode.Checked	
		for n in event.Node.Nodes:	   	
			n.Checked = checkState			
			
    def ActivateOption(self, sender, event ):
    	parent = sender.Parent
    	associatedControls = [p for p in parent.Controls if p.Name == sender.Text and p.GetType() == Panel][0]
    	restofcontrols = [p for p in parent.Controls if p.Name != sender.Text and p.GetType() == Panel]
    	if sender.Checked:
    		associatedControls.Enabled = True
    		for c in restofcontrols:
    			c.Enabled = False
    			
    def showtooltip(self, sender, event ):
    	ttp = ToolTip()
    	ttp.AutoPopDelay = 10000
    	ttp.SetToolTip(sender , sender.Tag)	

    def numsOnly(self, sender, event ):
    	if Char.IsDigit(event.KeyChar)==False and event.KeyChar != "." and Char.IsControl(event.KeyChar)==False:
    		event.Handled = True				
		

class mylistview(ListView):

	def __init__(self):
		self.Values = []

class mytrackbar(TrackBar):

	def __init__(self,startval,step):
		self.startval = startval
		self.step = step

class myDataGridView(DataGridView):

	def __init__(self):
		self.startcell = {}
		self.endcell = {}
		
class mygroupbox(GroupBox):

	def __init__(self):
		self.Values = []
		
class myTextBox(TextBox):

	def __init__(self):
		self._isNum = False	
		
#Form initialization

form = MultiTextBoxForm()
form.topmost()	
form.ControlBox = False
xlabel = 25
xinput = 150
formy = 10
if IN[8] > 350:	formwidth = IN[8]
else: formwidth = 350
fields = []
error = 0

#Description 

if IN[3] != "":
	des = Label()
	des.Font = Font("Arial", 15,FontStyle.Bold)
	des.Location = Point(xlabel,formy)
	des.AutoSize = True
	des.MaximumSize = Size(formwidth - 2 * xlabel,0)
	des.Text = IN[3]
	form.Controls.Add(des)
	formy = des.Bottom + 15
formheaderheight = formy

#Input form

# Create a container panel for all inputs
body = Panel()
body.Location = Point(0,formy)
body.Width = formwidth - 15


# Process form inputs
if isinstance(IN[0],list):
	inputtypes = IN[0]
else:
	inputtypes = [IN[0]]
# This definition is to handle the sorting of special characters
def remove_accents(input_str):
    nfkd_form = unicodedata.normalize('NFKD', input_str)
    only_ascii = nfkd_form.encode('ASCII', 'ignore')
    return only_ascii	

#Adding Logo 
#default logo in case no input	
def getImageByName(ImName):
	dynamo = Assembly.Load('DynamoCore')
	version = str(dynamo.GetName().Version)[:3]		
	dynPath = os.getenv('APPDATA')+"\\Dynamo\Dynamo Revit\\" + version 
	root = et.parse(dynPath + "\DynamoSettings.xml").getroot()
	logopaths = []
	for child in root:
		if child.tag == "CustomPackageFolders":
			for path in child:
				logopaths.append(path.text + "\packages\Data-Shapes\extra\\" + ImName)
				logopaths.append(path.text + "\Data-Shapes\extra\\" + ImName)
	deflogopath = ""
	for path in logopaths:
		if deflogopath == "":
			if os.path.isfile(path):
				deflogopath = path
				try:
					ima = Image.FromFile(deflogopath)
					bmp = Bitmap.FromFile(deflogopath)
					return ima,bmp
				except: 
					pass
					
try:
	if IN[4] != '':
		try:
			ima = Image.FromFile(IN[4])
			bmp = Bitmap.FromFile(IN[4])
		except:
			ima = IN[4]
			bmp = IN[4]

	else :
		_ims = getImageByName("a.png")
		ima = _ims[0]
		bmp = _ims[1]
		
	logo = Panel()
	if IN[6] == None:
		xlogo = 20
		ylogo = formy+10
	else:
		xlogo = 30
		ylogo = formy
	size = 110
	logo = PictureBox()
	ratio = (ima.Height)/(ima.Width)
	h = float(ima.Height)
	w = float(ima.Width)
	ratio = h/w
	logo.Size = Size(size,size*ratio)
	scaledimage = Bitmap(size,size*ratio)
	gr = Graphics.FromImage(scaledimage)
	gr.DrawImage(ima,0,0,size,size*ratio)
	logo.Image = ima
	logo.SizeMode = PictureBoxSizeMode.Zoom
	form.Controls.Add(logo)
	logo.Location = Point(xlogo,ylogo)
	#Setting icon 
	thumb = bmp.GetThumbnailImage(64, 64, bmp.GetThumbnailImageAbort,IntPtr.Zero)
	thumb.MakeTransparent();
	icon = Icon.FromHandle(thumb.GetHicon())
	form.Icon = icon

except :
	pass

def addinput(formbody,inputs,starty,xinput,rightmargin,labelsize,importcolorselection):
	y = starty
	for j in inputs:
		label = Label()
		label.Location = Point(xlabel,y+4)
		label.AutoSize = True
		label.MaximumSize = Size(labelsize,0)
		if j.__class__.__name__ == 'listview' and j.element_count > 0:
			label.Text = j.inputname + '\n(' + str(j.element_count) + ' element' + ("s" if j.element_count > 1 else "") + ')'
		else:
			try:
				label.Text = j.inputname
			except:
				pass
		formbody.Controls.Add(label)

		if j.__class__.__name__ == 'dropdown':
			cb = ComboBox()
			if j.inputname != "":
				cb.Width = formwidth - rightmargin - xinput
				cb.Location = Point(xinput,y)
			else:
				cb.Width = formwidth - rightmargin - xlabel
				cb.Location = Point(xlabel,y)
			cb.Sorted = j._sorted
			[cb.Items.Add(i) for i in j.keys() if not (i == 'inputname' or i == 'height' or i == 'defaultvalue' or i == 'highlight' or i == '_sorted' )]
			cb.Tag = j
			if j.defaultvalue != None:
				defindex = [i for i in cb.Items].index([i for i in j.keys() if not (i == 'inputname' or i == 'height' or i == 'defaultvalue' or i == 'highlight' or i == '_sorted' )][j.defaultvalue])
				cb.SelectedIndex = defindex
			formbody.Controls.Add(cb)
			form.output.append(cb)
			y = label.Bottom + 25
		#CHARTS is a work in progress
		'''
		if j.__class__.__name__ == 'uichart':
			ch = Chart()
			ch.Width = formwidth - rightmargin - xlabel
			ch.Location = Point(xlabel,y)
			ch.Height = 600
			ch.Series.Add("test")
			ch.Series["test"].XValueMember = "Date"
			ch.Series["test"].YValueMembers = "Percent"
			ch.Series[0].ChartType = SeriesChartType.ChartType.Bar
			dt = DataTable()
			dl = j.datalist
			for rindex in range(rngstart,len(dl)):
				row = dt.NewRow()
				for i in range(len(dl[rindex])):
					row[i] = dl[rindex][i]
				dt.Rows.Add(row)
			ch.DataSource = table
			ch.DataBind()
			formbody.Controls.Add(ch)
			y = ch.Bottom + 25
		'''
		if j.__class__.__name__ == 'uitreeview':
			tv = TreeView()
			tv.CheckBoxes = True
			titles = j._hastitles
			if j.inputname != "":
				tv.Width = formwidth - rightmargin - xinput
				tv.Location = Point(xinput,y)
			else:
				tv.Width = formwidth - rightmargin - xlabel
				tv.Location = Point(xlabel,y)
			tv.Height = j._height
			def treeIterationTitle(control, input):
				if isinstance(input,list):
					try:
						currentNode = TreeNode(remove_accents(input[0].ToString()))
						currentNode.Tag = ""
						input.pop(0)
					except:
						currentNode = TreeNode(control.Text +"."+ str(len(control.Nodes)+1))
						currentNode.Tag = ""
					control.Nodes.Add(currentNode)
					for i in input:
						treeIterationTitle(currentNode, i)
				else:
					item = TreeNode(remove_accents(input.ToString()))
					item.Tag = input
					control.Nodes.Add(item)	
			def treeIteration(control, input):
				if isinstance(input,list):
					currentNode = TreeNode(control.Text +"."+ str(len(control.Nodes)+1))
					currentNode.Tag = input
					control.Nodes.Add(currentNode)
					for i in input:
						treeIteration(currentNode, i)
				else:
					item = TreeNode(remove_accents(input.ToString()))
					item.Tag = input
					control.Nodes.Add(item)
			currentNode = TreeNode("List1")
			currentNode.Expand()				
			if titles:
				tv.Nodes.Add(currentNode)								
				for dl in j.datalist:
					treeIterationTitle(currentNode,dl)	
			else:
				tv.Nodes.Add(currentNode)								
				for dl in j.datalist:
					treeIteration(currentNode,dl)
			tv.AfterCheck += form.CheckChildren						
			formbody.Controls.Add(tv)
			form.output.append(tv)
			y = tv.Bottom + 25
		elif j.__class__.__name__ == 'listview':
			lvp = Panel()
			if j.inputname != "":
				lvp.Location = Point(xinput,y)
				lvp.Width = formwidth - rightmargin - xinput				
			elif j.inputname == "" and j.element_count != 0:
				lvp.Location = Point(xlabel,y+35)
				lvp.Width = formwidth - rightmargin - xlabel
			else : 
				lvp.Location = Point(xlabel,y)
				lvp.Width = formwidth - rightmargin - xlabel				
			lvp.Height = j.height + 25
			#Creating the listview box
			lv = mylistview()
			lv.Scrollable = True
			dummyheader = ColumnHeader()
			dummyheader.Text = ""
			dummyheader.Name = ""
			dummyheader.Width = -2
			lv.HeaderStyle = ColumnHeaderStyle.None
			lv.Columns.Add(dummyheader)
			lv.Values = j
			if not j.display_mode:
				lv.CheckBoxes = True
			lv.View = vi.Details
			lvItems =  [i for i in j.keys() if not (i == 'inputname' or i == 'height' or i == 'highlight' or i == 'display_mode' or i == 'element_count' or i == 'default_values' or i == 'sorted' or i == 'showId')]
			if j.sorted :
				lvItems = sorted(lvItems,key = remove_accents)
			else:
				pass
			[lv.Items.Add(i) for i in lvItems]
			lv.Location = Point(0,0)
			if j.inputname != "" and j.element_count != 0:
				lv.Width = formwidth - rightmargin - xinput
			elif j.inputname != "" and j.element_count == 0:
				lv.Width = formwidth - rightmargin - xinput
			else:
				lv.Width = formwidth - rightmargin - xlabel
			lv.Height = j.height
			lv.Scrollable = True
			lv.ItemCheck += form.updateallnone
			for i in j.default_values:
				defInd = lvItems.index([x for x in j.keys() if not (x == 'inputname' or x == 'height' or x == 'highlight' or x == 'display_mode' or x == 'element_count' or x == 'default_values' or x == 'sorted' or x == 'showId')][i])
				lv.Items[defInd].Checked = True
			#Click listview items to hilight and center in appropriate view
			if j.highlight :
				lv.MouseDown += form.setviewforelement
				lv.MouseUp += form.zoomcenter
				items = list(lv.Items)
				lv.FullRowSelect = True
				del items[::2]
				for item in items:
					item.BackColor = Color.FromArgb(230,243,255)
			#Creating select all and select none radiobuttons
			if not j.display_mode:
				rball = RadioButton()
				rball.Location = Point(0,(j.height)+5)
				rball.Width = 70
				rball.Text = "Select all"
				rball.Click += form.selectall
				rbnone = RadioButton()
				rbnone.Location = Point(80,(j.height)+5)
				rbnone.Width = 90
				rbnone.Text = "Select none"			
				rbnone.Click += form.selectnone			
			#Adding controls to panel
			lvp.Controls.Add(lv)
			if not j.display_mode:
				lvp.Controls.Add(rball)
				lvp.Controls.Add(rbnone)
			formbody.Controls.Add(lvp)
			if not j.display_mode:
				form.output.append(lv)
			y = lvp.Bottom + 25
		elif j.__class__.__name__ == 'uitext':
			tb = myTextBox()
			tb.Text = j.defaultvalue
			if j.inputname != "":
				tb.Width = formwidth  - rightmargin - xinput
				tb.Location = Point(xinput,y)
			else:
				tb.Width = formwidth - rightmargin - xlabel
				tb.Location = Point(xlabel,y)
			if j._isnum:
				tb._isNum = True
				tb.KeyPress += form.numsOnly
			formbody.Controls.Add(tb)
			formbody.Controls.Add(label)
			form.output.append(tb)
			y = label.Bottom + 25
		elif j.__class__.__name__ == 'tableview':
			#Creating grouping panel
			tvp = Panel()
			tvp.Location = Point(xlabel,y)
			tvp.Width = formwidth - rightmargin - xlabel
			if 50 + len(j.dataList) * 15 > 800:
				autoheight = 800
			else:
				autoheight = 50 + len(j.dataList) * 15				
			tvp.Height = autoheight + 73
			#Creating title
			titlep = Label()
			titlep.Text = j._tabletitle
			titlep.Width = formwidth - rightmargin - xlabel
			titlep.BackColor = Color.FromArgb(153,180,209)
			titlep.Font = Font("Arial", 11, FontStyle.Bold)
			titlep.TextAlign = ContentAlignment.MiddleLeft
			titlep.BorderStyle = BorderStyle.FixedSingle
			titlep.Location = Point(0,0)
			tvp.Controls.Add(titlep)
			#Creating data structure
			dg = myDataGridView()
			#dg.SelectionMode = DataGridViewSelectionMode.CellSelect
			dg.EnableHeadersVisualStyles = False				
			dt = DataTable()
			dl = j.dataList
			for i in range(len(dl[0])):
				if j._hasTitle:
					dt.Columns.Add(remove_accents(dl[0][i].ToString()))
					rngstart = 1
				else:
					dt.Columns.Add("Column " + str(i))
					rngstart = 0						
			for rindex in range(rngstart,len(dl)):
				row = dt.NewRow()
				for i in range(len(dl[rindex])):
					row[i] = dl[rindex][i]
				dt.Rows.Add(row)						
			dg.Tag = j._hasTitle				
			dg.DataSource = dt
			dg.ClipboardCopyMode = DataGridViewClipboardCopyMode.EnableWithAutoHeaderText
			dg.AutoSizeColumnsMode = DataGridViewAutoSizeColumnsMode.AllCells
			dg.Width = formwidth - rightmargin - xlabel
			dg.Location = Point(0,23)
			dg.Height = autoheight
			#Creatin Excel like drag copy functionalities
			dg.CellMouseDown += form.startCell
			dg.CellMouseUp += form.endCell
			#dg.MouseDown += form.startRowDrag
			#dg.MouseUp = 			
			tvp.Controls.Add(dg)			
			y = tvp.Bottom + 15
			#Adding export to excel button
			ex = Button()
			ex.Tag = [j._hasTitle , j._openExcel , j._showinfo , j._fileInfo]
			try:
				expImage = getImageByName("exp.png")[0]
				ex.BackgroundImage = expImage
			except:
				ex.Text = "Export"					
			ex.Width = 60	
			ex.Height = 30
			ex.Location = Point(formwidth - 125 ,dg.Bottom + 15)					
			tvp.Controls.Add(ex)
			ex.Click += form.exportToExcel
			#Adding filepath export textbox
			filepathtb = TextBox()
			filepathtb.Text = "ExportFileName"
			filepathtb.Location = Point(0 ,dg.Bottom + 20)
			filepathtb.Width = formwidth - xlabel - 125
			tvp.Controls.Add(filepathtb)
			#Adding copy to clipboard button
			cb = Button()
			#Adding panel to form
			formbody.Controls.Add(tvp)
			form.output.append(dg)
			y = tvp.Bottom + 25
			form.topmost()
		elif j.__class__.__name__ == 'uitextnote':
			gb = GroupBox()
			gb.Text = j.title
			gb.Parent = form
			gb.SendToBack()
			gb.BackColor = Color.Transparent
			gb.Location = Point(xlabel, y)
			tn = Label()
			tn.Location = Point(xlabel,18)
			tn.AutoSize = True
			tn.MaximumSize = Size(formwidth - rightmargin - 45 ,0)
			tn.Text = j.textnote
			tn.BringToFront()
			gb.Controls.Add(tn)
			gb.Size = Size(formwidth  - rightmargin - 25, tn.Bottom-tn.Top+25)  
			y = gb.Bottom + 25
			formbody.Controls.Add(gb)
		elif j.__class__.__name__ == 'uibool':
			yn = CheckBox()
			yn.Width = formwidth - xinput - rightmargin + 10
			yn.Location = Point(xinput,y)
			yn.Text = j.booltext
			g = yn.CreateGraphics()
			sizetext = g.MeasureString(yn.Text,yn.Font, formwidth - xinput - rightmargin -20)
			heighttext = sizetext.Height
			yn.Height = heighttext + 15
			yn.Checked = j.defaultvalue
			formbody.Controls.Add(yn)
			form.output.append(yn)
			y = yn.Bottom + 25
		elif j.__class__.__name__ == 'uiradio':
			yrb = 20
			rbs = []
			rbgroup = mygroupbox()
			if j.inputname != "":
				rbgroup.Width = formwidth - xinput - rightmargin
				rbgroup.Location = Point(xinput,y)
			else:
				rbgroup.Width = formwidth - xlabel - rightmargin
				rbgroup.Location = Point(xlabel,y)					
			rbgroup.Tag = j
			rbcounter = 0
			for key in j.keys():
				if key != 'inputname' and key != 'defaultvalue':
					rb = RadioButton()
					rb.Text = key 
					if j.inputname != "":
						rb.Width = formwidth - xinput - rightmargin - 35
					else:
						rb.Width = formwidth - xlabel - rightmargin - 35
					rb.Location = Point(20,yrb)
					if rbcounter == j.defaultvalue:
						rb.Checked = True
					rbgroup.Controls.Add(rb)
					g = rb.CreateGraphics()
					sizetext = g.MeasureString(key,rb.Font, formwidth - xinput - 90)
					heighttext = sizetext.Height
					rb.Height = heighttext + 15
					ybot = rb.Bottom
					yrb += heighttext + 12
					rbcounter += 1
				else:
					pass
			rbgroup.Height = ybot +20
			[rbgroup.Controls.Add(rb) for rb in rbs]
			formbody.Controls.Add(rbgroup)
			form.output.append(rbgroup)
			y = rbgroup.Bottom + 25
		elif j.__class__.__name__  == 'uifilepath':
			fp = Button()
			if j.inputname != "":
				fp.Width = formwidth - xinput - rightmargin
				fp.Location = Point(xinput,y)
			else:
				fp.Width = formwidth - xlabel - rightmargin		
				fp.Location = Point(xlabel,y)					
			fp.Tag = j.defaultvalue
			if not j.defaultvalue == "FilePath":
				fp.Tag = j.defaultvalue
				fp.MouseHover += form.showtooltip	
			fp.Text = j.buttontext					
			formbody.Controls.Add(fp)
			fp.Click += form.openfile
			form.output.append(fp)
			y = label.Bottom + 25
		elif j.__class__.__name__ == 'uidirectorypath':
			dp = Button()
			if j.inputname != "":
				dp.Width = formwidth - xinput - rightmargin
				dp.Location = Point(xinput,y)
			else:
				dp.Width = formwidth - xlabel - rightmargin		
				dp.Location = Point(xlabel,y)				
			dp.Tag = j.defaultvalue
			dp.Text = j.buttontext
			if not j.defaultvalue == "DirectoryPath":
				dp.Tag = j.defaultvalue
				dp.MouseHover += form.showtooltip
			dp.Text = j.buttontext					
			formbody.Controls.Add(dp)
			dp.Click += form.opendirectory
			form.output.append(dp)
			y = label.Bottom + 30
		elif j.__class__.__name__ == 'uiselectelements':
			se = Button()
			if j.inputname != "":
				se.Width = formwidth - xinput - rightmargin
				se.Location = Point(xinput,y)
			else:
				se.Width = formwidth - xlabel - rightmargin		
				se.Location = Point(xlabel,y)
			se.Text = j.buttontext

			formbody.Controls.Add(se)
			if j.multi == False:
				se.Click += form.pickobjects
			else:
				se.Click  += form.pickobject
			form.output.append(se)
			y = label.Bottom + 25
		elif j.__class__.__name__ == 'uiselectOrderedelements':
			se = Button()
			if j.inputname != "":
				se.Width = formwidth - xinput - rightmargin
				se.Location = Point(xinput,y)
			else:
				se.Width = formwidth - xlabel - rightmargin		
				se.Location = Point(xlabel,y)
			se.Text = j.buttontext
			formbody.Controls.Add(se)
			se.Click  += form.pickobjectsordered
			form.output.append(se)
			y = label.Bottom + 25
		elif j.__class__.__name__ == 'uiselectlinkedelements':
			se = Button()
			if j.inputname != "":
				se.Width = formwidth - xinput - rightmargin
				se.Location = Point(xinput,y)
			else:
				se.Width = formwidth - xlabel - rightmargin		
				se.Location = Point(xlabel,y)
			se.Text = j.buttontext
			formbody.Controls.Add(se)
			if j.multi == False:
				se.Click += form.picklinkedobjects
			else:
				se.Click  += form.picklinkedobject
			form.output.append(se)
			y = label.Bottom + 25
		elif j.__class__.__name__ == 'uiselectlinkedelementsofcat':
			sec = Button()
			if j.inputname != "":
				sec.Width = formwidth - xinput - rightmargin
				sec.Location = Point(xinput,y)
			else:
				sec.Width = formwidth - xlabel - rightmargin		
				sec.Location = Point(xlabel,y)
			sec.Text = j.buttontext
			sec.Tag = j.category
			formbody.Controls.Add(sec)
			if j.multi == False:
				sec.Click += form.picklinkedobjectsofcat
			else:
				sec.Click += form.picklinkedobjectofcat
			form.output.append(sec)
			y = label.Bottom + 25
		elif j.__class__.__name__ == 'uiselectelementsofcat':
			sec = Button()
			if j.inputname != "":
				sec.Width = formwidth - xinput - rightmargin
				sec.Location = Point(xinput,y)
			else:
				sec.Width = formwidth - xlabel - rightmargin		
				sec.Location = Point(xlabel,y)
			sec.Text = j.buttontext
			sec.Tag = j.category
			formbody.Controls.Add(sec)
			if j.multi == False:
				sec.Click += form.pickobjectsofcat
			else:
				sec.Click += form.pickobjectofcat
			form.output.append(sec)
			y = label.Bottom + 25
		elif j.__class__.__name__ == 'uiselectOrderedelementsofcat':
			sec = Button()
			if j.inputname != "":
				sec.Width = formwidth - xinput - rightmargin
				sec.Location = Point(xinput,y)
			else:
				sec.Width = formwidth - xlabel - rightmargin		
				sec.Location = Point(xlabel,y)
			sec.Text = j.buttontext
			sec.Tag = j.category
			formbody.Controls.Add(sec)
			sec.Click += form.pickobjectsofcatordered
			form.output.append(sec)
			y = label.Bottom + 25
		elif j.__class__.__name__ == 'uiselectfaces':
			sf = Button()
			if j.inputname != "":
				sf.Width = formwidth - xinput - rightmargin
				sf.Location = Point(xinput,y)
			else:
				sf.Width = formwidth - xlabel - rightmargin		
				sf.Location = Point(xlabel,y)
			sf.Text = j.buttontext
			formbody.Controls.Add(sf)
			sf.Click += form.pickfaces
			form.output.append(sf)
			y = label.Bottom + 25
		elif j.__class__.__name__ == 'uiselectpointsonface':
			spf = Button()
			if j.inputname != "":
				spf.Width = formwidth - xinput - rightmargin
				spf.Location = Point(xinput,y)
			else:
				spf.Width = formwidth - xlabel - rightmargin		
				spf.Location = Point(xlabel,y)
			spf.Text = j.buttontext
			formbody.Controls.Add(spf)
			spf.Click += form.pickpointsonface
			form.output.append(spf)
			y = label.Bottom + 25
		elif j.__class__.__name__ == 'uiselectedges':
			sed = Button()
			if j.inputname != "":
				sed.Width = formwidth - xinput - rightmargin
				sed.Location = Point(xinput,y)
			else:
				sed.Width = formwidth - xlabel - rightmargin		
				sed.Location = Point(xlabel,y)
			sed.Text = j.buttontext
			formbody.Controls.Add(sed)
			sed.Click += form.pickedges
			form.output.append(sed)
			y = label.Bottom + 25
			
		elif j.__class__.__name__ == 'uislider':
			gb = Panel()
			if j.defaultvalue == '':
				defval = j.minimum
			else:
				defval = j.defaultvalue
			sl = mytrackbar(j.minimum,j.step)
			if j.inputname != "":
				gb.Width = formwidth - xinput - rightmargin
				gb.Location = Point(xinput,y)
			else:
				gb.Width = formwidth - xlabel - rightmargin		
				gb.Location = Point(xlabel,y)
			gb.Height = 40
			sl.Minimum = 0
			sl.Maximum = (j.maximum-j.minimum)/j.step
			sl.Value = (defval - j.minimum) / j.step
			sl.TickFrequency = (j.maximum-j.minimum)/j.step/10
			sl.Location = Point(40,0)
			if j.inputname != "":
				sl.Width = formwidth - xinput - rightmargin - 35
			else:
				sl.Width = formwidth - xlabel -rightmargin - 35
			gb.Controls.Add(sl)
			form.output.append(sl)
			displabel = Label()
			displabel.Width = 50
			displabel.Location = Point(0,5)
			displabel.Text = str(defval)
			displabel.BringToFront()
			gb.Controls.Add(displabel)	
			formbody.Controls.Add(gb)			
			sl.Scroll += form.scroll
			y = label.Bottom + 25
		elif j.__class__.__name__ == 'uiimage':
			pic = Image.FromFile(j.image)
			im = PictureBox()
			if j.showborder:
				im.BorderStyle = BorderStyle.Fixed3D
			else:
				im.BorderStyle = BorderStyle.None
			ratio = (pic.Height)/(pic.Width)
			h = float(pic.Height)
			w = float(pic.Width)
			ratio = h/w
			image_maxsize = formwidth - xlabel - rightmargin
			im.Size = Size(image_maxsize,image_maxsize*ratio)
			scaledimage = Bitmap(image_maxsize,image_maxsize*ratio)
			gr = Graphics.FromImage(scaledimage)
			gr.DrawImage(pic,0,0,image_maxsize,image_maxsize*ratio)
			im.Image = pic
			im.SizeMode = PictureBoxSizeMode.Zoom
			formbody.Controls.Add(im)
			im.Location = Point(25,y+25)
			y = im.Bottom + 25
	
		elif j.__class__.__name__ == 'uicolorpick' and importcolorselection == 0:
			cp = Button()
			if j.inputname != "":
				cp.Width = formwidth - xinput - rightmargin
				cp.Location = Point(xinput,y)
			else:
				cp.Width = formwidth - xlabel - rightmargin		
				cp.Location = Point(xlabel,y)
			cp.Text = j.buttontext
			formbody.Controls.Add(cp)
			cp.Click += form.colorpicker
			form.output.append(cp)
			y = label.Bottom + 25			
		elif j.__class__.__name__ == 'uicolorpick' and importcolorselection == 1:
			importcolorselection = 2
		elif j.__class__.__name__ == 'uigroup':
			grouppanel = GroupBox()
			grouppanel.Text = j.groupname
			grouppanel.Location = Point(xlabel,y)
			grouppanel.Width = formwidth - 65
			#recursive implementation of the definition to process grouped inputs
			addinput(grouppanel,j.inputgroup,25,xinput-25,80,90,importcolorselection)
			formbody.Controls.Add(grouppanel)
			y = grouppanel.Bottom + 25
		elif j.__class__.__name__ == 'uiconditional':
			grouppanelcond = GroupBox()
			grouppanelcond.Location = Point(xlabel,y)
			grouppanelcond.Width = formwidth - 65				
			#recursive implementation of the definition to process conditional groups of inputs
			panlist = []
			yp = 25
			xrb = 25
			for i,d in zip(j._Conditions,j._GroupedInputs):	
				rb = RadioButton()
				rb.CheckedChanged += form.ActivateOption
				rb.Text = i
				rb.Location	= Point(xrb,10)
				rb.Width = 95					
				grouppanelcond.Controls.Add(rb)				
				condition_pannel = Panel()
				condition_pannel.Name = i
				condition_pannel.Top = yp
				condition_pannel.Width = formwidth - 65
				condition_pannel.BackColor = Color.Transparent
				condition_pannel.BringToFront()					
				addinput(condition_pannel,d,25,xinput-25,80,90,importcolorselection)
				panlist.append(condition_pannel)
				yp = condition_pannel.Bottom - 25
				xrb += 100
			for pan in panlist:
				grouppanelcond.Controls.Add(pan)
			grouppanelcond.Height = sum([p.Height for p in panlist]) - (len(panlist)-2)*25
			grouppanelcond.BackColor = Color.Transparent				
			formbody.Controls.Add(grouppanelcond)
			y = grouppanelcond.Bottom + 25		
							
		formbody.Height = y



# process input lists 
addinput(body,inputtypes,0,xinput,40,120,importcolorselection)

#add the formbody panel to the form
form.Controls.Add(body)		


if IN[6] != None:
	if IN[8] > 400:
		formy += 50
		xinput = 270
	else:
		formy = logo.Bottom + 20
else:
	formy += 50



#Adding validation button

button = Button()
button.Text = IN[1]
button.Width = formwidth - xinput - 40
button.Location = Point (xinput,formy)
button.Click += form.setclose
form.Controls.Add(button)
form.MaximizeBox = False
form.MinimizeBox = False
form.FormBorderStyle = FormBorderStyle.FixedSingle

#Adding Cancel button
if IN[6] != None:
	cancelbutton = Button()
	cancelbutton.Text = IN[6]
	cancelbutton.Width = 120
	cancelbutton.Name = "Cancel"
	cancelbutton.Location = Point (xinput -120 ,formy)
	cancelbutton.Click += form.setclose
	form.Controls.Add(cancelbutton)
	form.CancelButton = cancelbutton

#Adding link to help

if IN[5] != None :
	helplink = LinkLabel()
	helplink.Text = "Help"
	helplink.Tag = IN[5]
	helplink.Click += form.openurl
	helplink.Location = Point(formwidth - 65,formy+30)
	form.Controls.Add(helplink)
else:
	pass	
		
form.ShowIcon = True
form.Width = formwidth
form.Height = formy + 120
formfooterheight = form.Height - formheaderheight

# Make formbody scrollable

# if the form is longer than its maximum height, do the following:
# modify the form height
# make the formbody panel scrollable
if form.Height + body.Height > IN[7] and IN[7] > 0:
	formbody_calculatedheight = IN[7] - form.Height
	# make sure the formbody is at least 100 px high
	if formbody_calculatedheight < 100: formbody_calculatedheight = 100
	body.Height = formbody_calculatedheight
	form.Height = form.Height + formbody_calculatedheight
	# this (and apparently only this) will implement a vertical AutoScroll *only*
	# http://stackoverflow.com/a/28583501
	body.HorizontalScroll.Maximum = 0
	body.AutoScroll = False
	body.VerticalScroll.Visible = False
	body.AutoScroll = True
	body.BorderStyle = BorderStyle.Fixed3D
else:
	form.Height = form.Height + body.Height
# Move footer elements
logo.Location = Point(logo.Location.X, logo.Location.Y + body.Height)
button.Location = Point(button.Location.X, button.Location.Y + body.Height)
if IN[6] != None: cancelbutton.Location = Point(cancelbutton.Location.X, cancelbutton.Location.Y + body.Height)
if IN[5] != None: helplink.Location = Point(helplink.Location.X, helplink.Location.Y + body.Height)

#Positionning the form at top left of current view
uiviews = uidoc.GetOpenUIViews()
if doc.ActiveView.IsValidType(doc.ActiveView.GetTypeId()):
	activeviewid = doc.ActiveView.Id
	activeUIView = [v for v in uiviews if v.ViewId == activeviewid][0]
else:
	activeUIView = uiviews[0]
rect = activeUIView.GetWindowRectangle()
form.StartPosition = FormStartPosition.Manual
form.Location = Point(rect.Left-7,rect.Top)
	
if IN[2]:
	if importcolorselection != 2:
		Application.Run(form)
		result = form.values
		OUT = result,True, form.cancelled
	else:
		OUT = ['ColorSelection input is only available With Revit 2017'] , False, False
else :
	OUT = ['Set toggle to true!'] , False, False
except:
import traceback
OUT = traceback.format_exc() , "error", "error"
# ----------------------------------------
code_block_28 = CodeBlock(a=python_script) { a[1]; }

# group: Changed
overrideColorInView_2 = Element.OverrideColorInView(element=code_block_28, color=code_block_27.color2)

code_block_29 = CodeBlock(a=python_script) { a[2]; }

# group: New
overrideColorInView_3 = Element.OverrideColorInView(element=code_block_29, color=code_block_27.color3)

code_block_30 = CodeBlock { " "; }
code_block_31 = CodeBlock { "OK"; }
code_block_32 = CodeBlock { "Accept Changes"; }
ui_boolean_input = Custom[UI.Boolean input](SideText=code_block_32)
boolean_2 = BoolSelector(false)

# group: obtain point for tags
startPoint = Curve.StartPoint(curve=getLocation)
endPoint = Curve.EndPoint(curve=getLocation)
byTwoPoints = Vector.ByTwoPoints(start=startPoint, end=endPoint)
ZAxis = Vector.ZAxis()
cross = Vector.Cross(vector=byTwoPoints, cross=ZAxis)
normalized = Vector.Normalized(vector=cross)
code_block_33 = CodeBlock(vct=cross) { vct.Y>0; }
code_block_34 = CodeBlock { 350; }
code_block_35 = CodeBlock { -350; }
if_ = If(test=code_block_33, true=code_block_34, false=code_block_35)
scale = Vector.Scale(vector=normalized, scale_factor=if_)
translate = Geometry.Translate(geometry=pointAtParameter, direction=scale)

code_block_36 = CodeBlock { 1; }

# group: Tag Element with new tag
family_types = FamilyTypes(index=47)
string_20 = StringInput("Mark")
setParameterByName = Element.SetParameterByName(element=select_model_elements, parameterName=string_20, value=flatten)
create_annotation_tag = Custom[Create Annotation Tag](TagLocations=translate, TagType=family_types, Elements=setParameterByName, Views=activeView, RunIt=code_block_36)

code_block_37 = CodeBlock(passthrough=boolean_2, waitfor=create_annotation_tag) { [passthrough,waitfor][0]; }
code_block_38 = CodeBlock { "Cancel"; }
ui_multipleinputform = Custom[UI.MultipleInputForm ++](Logo_optional=code_block_30, ButtonText_optional=code_block_31, Inputs=ui_boolean_input, Toggle=code_block_37, CancelButtonText_optional=code_block_38)
python_script_6 = Python(IN[0]=select_model_elements, IN[1]=ui_multipleinputform.User_Inputs)
# ---------- python_script_6.python (32 lines) ----------
import clr
clr.AddReference('RevitAPI')
from Autodesk.Revit.DB import *

clr.AddReference("RevitNodes")
import Revit
clr.ImportExtensions(Revit.Elements)

clr.AddReference("RevitServices")
import RevitServices
from RevitServices.Persistence import DocumentManager
from RevitServices.Transactions import TransactionManager

doc = DocumentManager.Instance.CurrentDBDocument
items = UnwrapElement(IN[0])
view = doc.ActiveView
booleans = []

override = OverrideGraphicSettings()

TransactionManager.Instance.EnsureInTransaction(doc)
for item in items:
	try:
		view.SetElementOverrides(item.Id, override)
		booleans.append(True)
	except: booleans.append(False)
TransactionManager.Instance.TransactionTaskDone()

if IN[1] == False:
	OUT = items
else:
	OUT = "Do nothing"
# ----------------------------------------
string_21 = StringInput("Mark")
setParameterByName_2 = Element.SetParameterByName(element=python_script_6, parameterName=string_21, value=getParameterValueByName_4)
select_model_elements_2 = DSModelElementsSelection()  # 2 picked in the model
boolean_3 = BoolSelector(true)
code_block_39 = CodeBlock { "a"; "b"; }
python_script_7 = Python(IN[0]=select_model_elements_2, IN[1]=boolean_3, IN[2]=code_block_39.out0, IN[3]=code_block_39.out1)  # frozen
# ---------- python_script_7.python (173 lines) ----------
import clr

clr.AddReference("System.Windows.Forms")
from System.Windows.Forms import Application, Button, Form, Label, TextBox, CheckBox, FolderBrowserDialog, OpenFileDialog, DialogResult, ComboBox, FormBorderStyle, FormStartPosition

clr.AddReference("System.Drawing")
from System.Drawing import *

clr.AddReference("System")
from System import EventHandler


clr.AddReference("RevitAPIUI")
from Autodesk.Revit.UI import IExternalEventHandler, ExternalEvent

clr.AddReference("RevitAPI")
from Autodesk.Revit.DB import Transaction
# noinspection PyUnresolvedReferences
from Autodesk.Revit.Exceptions import InvalidOperationException


clr.AddReference('RevitServices')
from RevitServices.Persistence import DocumentManager


global result



doc = DocumentManager.Instance.CurrentDBDocument
uidoc = DocumentManager.Instance.CurrentUIApplication.ActiveUIDocument


elements = UnwrapElement(IN[0])


def setMark(elements):
	for ele in elements:
		p = ele.LookupParameter("Comments")
		p.Set("A")




def setMarkBack(elements):
	for ele in elements:
		p = ele.LookupParameter("Comments")
		p.Set("O")
	

"""
# Simple function we want to run
def delete_elements():
    t = Transaction(doc, "Failing script")
    t.Start()
    for elid in uidoc.Selection.GetElementIds():
        doc.Delete(elid)
    t.Commit()
"""
t = Transaction(doc, "Starting")

t.Start()

setMark(elements)

t.Commit()






	



def close(form):
	form.Close()


def Button2Click(sender, e):
	form.Close()
	OUT = 1
	

label1 = Label();
button1 = Button();
button2 = Button();

# A simple WPF form used to call the ExternalEvent
class ModelessForm(Form):
	"""
	Simple modeless form sample
	"""
	def __init__(self):
		self.Text = 'Data-Shapes | Multi Input UI ++'
		self.output = []
		self.values = []
		self.cancelled = False


	def setclose(self, sender, event):
		cbindexread = 0
		if sender.Name != "Cancel":
			self.values = "Accepted"
		else:
			self.values = "Cancelled"
			self.cancelled = True
		self.Close()
	
	def reset(self, sender, event):
		pass



# Let's launch our beautiful and useful form !
form = ModelessForm()
form.TopMost = True


label1.Location = Point(12, 9);
label1.Name = "label1";
label1.Size = Size(219, 63);
label1.TabIndex = 2;
label1.Text = "You are updating the beam tags. Click OK to accept the changes or Cancel to discard them";
label1.UseCompatibleTextRendering = True;





button1.Location = Point(10, 75);
button1.Name = "button1";
button1.Size = Size(88, 32);
button1.TabIndex = 0;
button1.Text = "OK";
button1.UseCompatibleTextRendering = True;
button1.UseVisualStyleBackColor = True;
button1.Click += EventHandler(form.setclose);

button2.DialogResult = DialogResult.Cancel;
button2.Location = Point(134, 75);
button2.Name = "Cancel";
button2.Size = Size(88, 32);
button2.TabIndex = 1;
button2.Text = "Cancel";
button2.UseCompatibleTextRendering = True;
button2.UseVisualStyleBackColor = True;
button2.Click += EventHandler(form.setclose);



ClientSize = Size(125, 100);
form.Controls.Add(button1);
form.Controls.Add(button2);
form.Controls.Add(label1);

#result = form.values



Application.Run(form)
result = form.values

if result != "Cancelled":
	"ok"
else:
	t = Transaction(doc, "Failing script")
	t.Start()
	setMarkBack(elements)
	t.Commit()

OUT = result, form.cancelled
# ----------------------------------------
python_script_8 = Python()  # frozen; unwired: IN[0]
# ---------- python_script_8.python (52 lines) ----------
import clr

clr.AddReference("System.Windows.Forms")
from System.Windows.Forms import Application, Button, Form, Label, TextBox, CheckBox, FolderBrowserDialog, OpenFileDialog, DialogResult, ComboBox, FormBorderStyle, FormStartPosition

clr.AddReference("System.Drawing")
from System.Drawing import *

clr.AddReference("System")
from System import EventHandler


clr.AddReference("RevitAPIUI")
from Autodesk.Revit.UI import IExternalEventHandler, ExternalEvent

clr.AddReference("RevitAPI")
from Autodesk.Revit.DB import Transaction
# noinspection PyUnresolvedReferences
from Autodesk.Revit.Exceptions import InvalidOperationException


clr.AddReference('RevitServices')
from RevitServices.Persistence import DocumentManager


global result



doc = DocumentManager.Instance.CurrentDBDocument
uidoc = DocumentManager.Instance.CurrentUIApplication.ActiveUIDocument






def delete_elements():
	t = Transaction(doc, "Failing script")
	t.Start()
	for elid in uidoc.Selection.GetElementIds():
		ele = doc.GetElement(elid)
		p = ele.LookupParameter("Mark")
		p.Set("A")
	t.Commit()
	return t




# Assign your output to the OUT variable.
OUT = delete_elements()
# ----------------------------------------
python_script_9 = Python(IN[0]=boolean_3)
# ---------- python_script_9.python (108 lines) ----------
import clr

clr.AddReference("System.Windows.Forms")
from System.Windows.Forms import Application, Button, Form, Label, TextBox, CheckBox, FolderBrowserDialog, OpenFileDialog, DialogResult, ComboBox, FormBorderStyle, FormStartPosition

clr.AddReference("System.Drawing")
from System.Drawing import *

clr.AddReference("System")
from System import EventHandler


global result


def close(form):
	form.Close()


def Button2Click(sender, e):
	form.Close()
	OUT = 1
	

label1 = Label();
button1 = Button();
button2 = Button();

# A simple WPF form used to call the ExternalEvent
class ModelessForm(Form):
	"""
	Simple modeless form sample
	"""
	def __init__(self):
		self.Text = 'Beam Mark Update'
		self.output = []
		self.values = []
		self.cancelled = False


	def setclose(self, sender, event):
		cbindexread = 0
		if sender.Name != "Cancel":
			self.values = "Accepted"
		else:
			self.values = "Cancelled"
			self.cancelled = True
		self.Close()
	
	def reset(self, sender, event):
		pass



# Let's launch our beautiful and useful form !
form = ModelessForm()
form.TopMost = True
form.Height = 150
form.Width = 340
form.StartPosition = FormStartPosition.CenterScreen

label1.Location = Point(12, 9);
label1.Name = "label1";
label1.Size = Size(300, 63);
label1.TabIndex = 2;
label1.Text = "You are updating the beam tags. Once you are happy with the changes, click OK to accept or Cancel to discard them.";
label1.UseCompatibleTextRendering = True;


button1.Location = Point(40, 65);
button1.Name = "button1";
button1.Size = Size(88, 32);
button1.TabIndex = 0;
button1.Text = "OK";
button1.UseCompatibleTextRendering = True;
button1.UseVisualStyleBackColor = True;
button1.Click += EventHandler(form.setclose);

button2.DialogResult = DialogResult.Cancel;
button2.Location = Point(175, 65);
button2.Name = "Cancel";
button2.Size = Size(88, 32);
button2.TabIndex = 1;
button2.Text = "Cancel";
button2.UseCompatibleTextRendering = True;
button2.UseVisualStyleBackColor = True;
button2.Click += EventHandler(form.setclose);




form.Controls.Add(button1);
form.Controls.Add(button2);
form.Controls.Add(label1);

#result = form.values



Application.Run(form)
result = form.values

if result != "Cancelled":
	"ok"
else:
	"cancel"

OUT = result, form.cancelled
# ----------------------------------------
