# Dynamo graph modifyFilters02.dyn (Dynamo 1.3.1.1736)

current = Document.Current()
activeView = Document.ActiveView(current)
resetOverridesInView = Custom[Element.ResetOverridesInView](view=activeView)  # Resets all overrides for an element in a given view; unwired: element
all_elements_in_active_view = ElementsInView()
all_elements_in_active_view_2 = ElementsInView()
name = Category.Name(all_elements_in_active_view_2)
code_block = CodeBlock { ""; }
code_block_2 = CodeBlock(a=name, b=code_block) { a==b; }
filterByBoolMask = List.FilterByBoolMask(list=all_elements_in_active_view_2, mask=code_block_2)
code_block_3 = CodeBlock { "Comments"; }
parameterByName = Parameter.ParameterByName(element=filterByBoolMask.out, name=code_block_3)
code_block_4 = CodeBlock(a=parameterByName) { a[0]; }
python_script = Python()  # unwired: IN[0]
# ---------- python_script.python (50 lines) ----------
import clr
clr.AddReference('ProtoGeometry')
from Autodesk.DesignScript.Geometry import *


# Import DocumentManager and TransactionManager
clr.AddReference("RevitServices")
import RevitServices
from RevitServices.Persistence import DocumentManager
from RevitServices.Transactions import TransactionManager


# Import RevitAPI
clr.AddReference("RevitAPI")
import Autodesk
from Autodesk.Revit.DB import *


doc = DocumentManager.Instance.CurrentDBDocument
uiapp = DocumentManager.Instance.CurrentUIApplication
app = uiapp.Application


from System.Collections.Generic import *


# Import ToDSType(bool) extension method
clr.AddReference("RevitNodes")
import Revit
clr.ImportExtensions(Revit.Elements)

refschedule = UnwrapElement(IN[0])
tgtschedules = UnwrapElement(IN[1])
tgtstrings = IN[2]

refdefinition = refschedule.Definition
reffilter = refdefinition.GetFilter(0)

TransactionManager.Instance.EnsureInTransaction(doc)

for tgtstring in tgtstrings
	tgtfilter = reffilter.SetValue(tgtstring)

for tgtschedule in tgtschedules:
	tgtdefinition = tgtschedule.Definition
	tgtdefinition.InsertFilter(reffilter, 0)

TransactionManager.Instance.TransactionTaskDone()

OUT = tgtschedules
# ----------------------------------------
select_rule_type = RuleTypes("Equals")
code_block_5 = CodeBlock { "2"; }

# group: single item
python_script_2 = Python(IN[1]=code_block_5)  # unwired: IN[0]
# ---------- python_script_2.python (82 lines) ----------
import clr
clr.AddReference('ProtoGeometry')
from Autodesk.DesignScript.Geometry import *


# Import DocumentManager and TransactionManager
clr.AddReference("RevitServices")
import RevitServices
from RevitServices.Persistence import DocumentManager
from RevitServices.Transactions import TransactionManager


# Import RevitAPI
clr.AddReference("RevitAPI")
import Autodesk
from Autodesk.Revit.DB import *


doc = DocumentManager.Instance.CurrentDBDocument
uiapp = DocumentManager.Instance.CurrentUIApplication
app = uiapp.Application


from System.Collections.Generic import *


# Import ToDSType(bool) extension method
clr.AddReference("RevitNodes")
import Revit
clr.ImportExtensions(Revit.Elements)

filterElement = UnwrapElement(IN[0])

setValue = IN[1]

#categories = List[Autodesk.Revit.DB.ElementId]()

#categories.Add(ElementId(BuiltInCategory.OST_Walls))

parameterCollector = FilteredElementCollector(doc)

#parameter = parameterCollector.OfClass(typeof(Autodesk.Revit.DB.Wall)).FirstElement().get_Parameter("Comments")
"""
comment_param = BuiltInParameter.ALL_MODEL_INSTANCE_COMMENTS

parameter = Autodesk.Revit.DB.FilteredElementCollector(DocumentManager.Instance.CurrentDBDocument).OfClass(clr.GetClrType(Wall)).FirstElement().get_Parameter(comment_param)
"""
filterRules = List[Autodesk.Revit.DB.FilterRule]()

oldRules = filterElement.GetRules()
ruleType = []


for fdr in oldRules:
	ruleType.append(fdr.GetEvaluator().GetType())


less = clr.GetClrType(FilterNumericLess)
#ruleType.append(fdr.GetEvaluator().GetType().Equals(clr.GetClrType(FilterNumericLess)))

#filterRules.Add(ParameterFilterRuleFactory.CreateEqualsRule(parameter.Id, setValue, True));

for fdr in oldRules:
	if fdr.GetEvaluator().GetType().Equals(clr.GetClrType(FilterStringLess)):
		filterRules.Add(ParameterFilterRuleFactory.CreateLessRule(filterElement.GetRuleParameters()[0], setValue, True))
	elif fdr.GetEvaluator().GetType().Equals(clr.GetClrType(FilterStringEquals)):
		filterRules.Add(ParameterFilterRuleFactory.CreateEqualsRule(filterElement.GetRuleParameters()[0], setValue, True))
	else:
		"fine"


TransactionManager.Instance.EnsureInTransaction(doc)

#filterElement.ClearRules()
filterElement.SetRules(filterRules);
 
TransactionManager.Instance.TransactionTaskDone()


#OUT = filterElement.Name, , filterElement.GetCategoryIds(), filterElement.GetRuleParameters(), filterElement.RuleData()

OUT = filterElement.Name, filterElement.GetCategories(), filterElement.GetRuleParameters(),oldRules, ruleType, less
# ----------------------------------------

id = Element.Id(parameterByName)
getBuiltInParamterName = Archilab.Grimshaw.Elements.Parameter.GetBuiltInParamterName(filterByBoolMask.out, code_block_3)
get_all_filter = Custom[Get All Filter]()  # Get all Filter

# group: list of filters, 1 rule
python_script_3 = Python(IN[0]=get_all_filter.Element)  # unwired: IN[1]
# ---------- python_script_3.python (49 lines) ----------
import clr
clr.AddReference('ProtoGeometry')
from Autodesk.DesignScript.Geometry import *


# Import DocumentManager and TransactionManager
clr.AddReference("RevitServices")
import RevitServices
from RevitServices.Persistence import DocumentManager
from RevitServices.Transactions import TransactionManager


# Import RevitAPI
clr.AddReference("RevitAPI")
import Autodesk
from Autodesk.Revit.DB import *


doc = DocumentManager.Instance.CurrentDBDocument
uiapp = DocumentManager.Instance.CurrentUIApplication
app = uiapp.Application


from System.Collections.Generic import *


# Import ToDSType(bool) extension method
clr.AddReference("RevitNodes")
import Revit
clr.ImportExtensions(Revit.Elements)

filterElements = UnwrapElement(IN[0])

setValue = IN[1]

fSet = []

TransactionManager.Instance.EnsureInTransaction(doc)

for f in filterElements:
	
	filterRules = List[Autodesk.Revit.DB.FilterRule]()
	filterRules.Add(ParameterFilterRuleFactory.CreateEqualsRule(f.GetRuleParameters()[0], setValue, True));
	f.SetRules(filterRules);
	fSet.append(f.Name)
 
TransactionManager.Instance.TransactionTaskDone()

OUT = fSet
# ----------------------------------------

code_block_6 = CodeBlock { a[1]; }  # unwired: a
code_block_7 = CodeBlock { "Week"; }
contains = String.Contains(str=get_all_filter.Name, searchFor=code_block_7)
filterByBoolMask_2 = List.FilterByBoolMask(list=get_all_filter.Element, mask=contains)
code_block_8 = CodeBlock { 4; }

# group: list of filters multiple rules
python_script_4 = Python(IN[0]=filterByBoolMask_2.in, IN[1]=code_block_8)
# ---------- python_script_4.python (63 lines) ----------
import clr
clr.AddReference('ProtoGeometry')
from Autodesk.DesignScript.Geometry import *


# Import DocumentManager and TransactionManager
clr.AddReference("RevitServices")
import RevitServices
from RevitServices.Persistence import DocumentManager
from RevitServices.Transactions import TransactionManager


# Import RevitAPI
clr.AddReference("RevitAPI")
import Autodesk
from Autodesk.Revit.DB import *


doc = DocumentManager.Instance.CurrentDBDocument
uiapp = DocumentManager.Instance.CurrentUIApplication
app = uiapp.Application


from System.Collections.Generic import *


# Import ToDSType(bool) extension method
clr.AddReference("RevitNodes")
import Revit
clr.ImportExtensions(Revit.Elements)

filterElements = UnwrapElement(IN[0])

setValue = IN[1].ToString()

filterNames = []
ruleType = []

	
TransactionManager.Instance.EnsureInTransaction(doc)

for filter in filterElements:
	oldRules = filter.GetRules()
	filterRules = List[Autodesk.Revit.DB.FilterRule]()
	for fdr in oldRules:
		ruleType.append(fdr.GetEvaluator().GetType())
		filterNames.append(filter.Name)
		if fdr.GetEvaluator().GetType().Equals(clr.GetClrType(FilterStringLess)):
			filterRules.Add(ParameterFilterRuleFactory.CreateLessRule(filter.GetRuleParameters()[0], setValue, True))
		elif fdr.GetEvaluator().GetType().Equals(clr.GetClrType(FilterStringEquals)):
			filterRules.Add(ParameterFilterRuleFactory.CreateEqualsRule(filter.GetRuleParameters()[0], setValue, True))
		elif fdr.GetEvaluator().GetType().Equals(clr.GetClrType(FilterStringGreater)):
			filterRules.Add(ParameterFilterRuleFactory.CreateGreaterRule(filter.GetRuleParameters()[0], setValue, True))
		else:
			break
		filter.SetRules(filterRules);
 
TransactionManager.Instance.TransactionTaskDone()


#OUT = filterElement.Name, , filterElement.GetCategoryIds(), filterElement.GetRuleParameters(), filterElement.RuleData()

OUT = filterNames, ruleType
# ----------------------------------------

name_2 = Element.Name(filterByBoolMask_2.in)
