# Dynamo graph modifyFiltersDanimo.dyn (Dynamo 1.3.1.1736)

current = Document.Current()
activeView = Document.ActiveView(current)
resetOverridesInView = Custom[Element.ResetOverridesInView](view=activeView)  # Resets all overrides for an element in a given view; unwired: element
all_elements_in_active_view = ElementsInView()
all_elements_in_active_view_2 = ElementsInView()
name = Category.Name(all_elements_in_active_view_2)
code_block = CodeBlock { ""; }
code_block_2 = CodeBlock(a=name, b=code_block) { a==b; }
filterByBoolMask = List.FilterByBoolMask(list=all_elements_in_active_view_2, mask=code_block_2)
code_block_3 = CodeBlock { "Comments"; }
parameterByName = Parameter.ParameterByName(element=filterByBoolMask.out, name=code_block_3)
code_block_4 = CodeBlock(a=parameterByName) { a[0]; }
get_all_filter = Custom[Get All Filter]()  # Get all Filter
id = Element.Id(parameterByName)
getBuiltInParamterName = Archilab.Grimshaw.Elements.Parameter.GetBuiltInParamterName(filterByBoolMask.out, code_block_3)
python_script = Python()
# ---------- python_script.python (32 lines) ----------
import clr
clr.AddReference('ProtoGeometry')
from Autodesk.DesignScript.Geometry import *

# Import DocumentManager and TransactionManager
clr.AddReference("RevitServices")
import RevitServices
from RevitServices.Persistence import DocumentManager
from RevitServices.Transactions import TransactionManager

# Import RevitAPI
clr.AddReference("RevitAPI")
import Autodesk
from Autodesk.Revit.DB import *

doc = DocumentManager.Instance.CurrentDBDocument

from System.Collections.Generic import *

# Import ToDSType(bool) extension method
clr.AddReference("RevitNodes")
import Revit
clr.ImportExtensions(Revit.Elements)

#collect all views in the model
collector = FilteredElementCollector(doc)
views = collector.OfClass(FilterElement).ToElements()

view = []
for i in views:
	view.append(i.ToDSType(True))
OUT = view
# ----------------------------------------
name_2 = Element.Name(python_script)

# group: Select the filter to modify
code_block_5 = CodeBlock { "Week"; }
contains = String.Contains(str=name_2, searchFor=code_block_5)
filterByBoolMask_2 = List.FilterByBoolMask(list=python_script, mask=contains)

code_block_6 = CodeBlock { 4; }

# group: list of filters, multiple rules, 1 value to set
python_script_2 = Python(IN[0]=filterByBoolMask_2.in, IN[1]=code_block_6)
# ---------- python_script_2.python (63 lines) ----------
import clr
clr.AddReference('ProtoGeometry')
from Autodesk.DesignScript.Geometry import *


# Import DocumentManager and TransactionManager
clr.AddReference("RevitServices")
import RevitServices
from RevitServices.Persistence import DocumentManager
from RevitServices.Transactions import TransactionManager


# Import RevitAPI
clr.AddReference("RevitAPI")
import Autodesk
from Autodesk.Revit.DB import *


doc = DocumentManager.Instance.CurrentDBDocument
uiapp = DocumentManager.Instance.CurrentUIApplication
app = uiapp.Application


from System.Collections.Generic import *


# Import ToDSType(bool) extension method
clr.AddReference("RevitNodes")
import Revit
clr.ImportExtensions(Revit.Elements)

filterElements = UnwrapElement(IN[0])

setValue = IN[1].ToString()

filterNames = []
ruleType = []

	
TransactionManager.Instance.EnsureInTransaction(doc)

for filter in filterElements:
	oldRules = filter.GetRules()
	filterRules = List[Autodesk.Revit.DB.FilterRule]()
	for fdr in oldRules:
		ruleType.append(fdr.GetEvaluator().GetType())
		filterNames.append(filter.Name)
		if fdr.GetEvaluator().GetType().Equals(clr.GetClrType(FilterStringLess)):
			filterRules.Add(ParameterFilterRuleFactory.CreateLessRule(filter.GetRuleParameters()[0], setValue, True))
		elif fdr.GetEvaluator().GetType().Equals(clr.GetClrType(FilterStringEquals)):
			filterRules.Add(ParameterFilterRuleFactory.CreateEqualsRule(filter.GetRuleParameters()[0], setValue, True))
		elif fdr.GetEvaluator().GetType().Equals(clr.GetClrType(FilterStringGreater)):
			filterRules.Add(ParameterFilterRuleFactory.CreateGreaterRule(filter.GetRuleParameters()[0], setValue, True))
		else:
			break
		filter.SetRules(filterRules);
 
TransactionManager.Instance.TransactionTaskDone()


#OUT = filterElement.Name, , filterElement.GetCategoryIds(), filterElement.GetRuleParameters(), filterElement.RuleData()

OUT = filterNames, ruleType
# ----------------------------------------

get_revit_activeview = Custom[Get Revit ActiveView]()  # Active View
string = StringInput("C:\images\")
boolean = BoolSelector(false)
code_block_7 = CodeBlock { 1; }
step = Core.Counter.Step(boolean, code_block_7)
count = Core.Counter.Count(step)
code_block_8 = CodeBlock(path=string, number=count) { path+Math.Floor(number)+".jpg"; }
exportAsImage = View.ExportAsImage(get_revit_activeview, code_block_8)
