# Dynamo graph moveBeamEnd.dyn (Dynamo 1.3.2.2480)

python_script = Python()  # unwired: IN[0]
# ---------- python_script.python (30 lines) ----------
import clr
clr.AddReference('RevitAPI')
from Autodesk.Revit.DB import *

clr.AddReference("RevitNodes")
import Revit
clr.ImportExtensions(Revit.GeometryConversion)

clr.AddReference('ProtoGeometry')
from Autodesk.DesignScript.Geometry import *

items = UnwrapElement(IN[0])

lines = []

for item in items:
	lines.append(item.Location.Curve.ToProtoType())

Pts = []


for line in lines:
	pt = []
	pt.append(Curve.PointAtParameter(line,0))
	stPt = Curve.PointAtParameter(line,0)
	endPt = Curve.PointAtParameter(line,1)
	pt.append(Point.ByCoordinates(stPt.X,stPt.Y,endPt.Z))
	Pts.append(pt)

OUT = Pts
# ----------------------------------------
python_script_2 = Python()  # unwired: IN[0], IN[1]
# ---------- python_script_2.python (42 lines) ----------
import clr

clr.AddReference("RevitServices")
import RevitServices
from RevitServices.Persistence import DocumentManager
from RevitServices.Transactions import TransactionManager
doc = DocumentManager.Instance.CurrentDBDocument

clr.AddReference("RevitAPI")
import Autodesk
from Autodesk.Revit.DB import *

clr.AddReference("RevitNodes")
import Revit
clr.ImportExtensions(Revit.Elements)
clr.ImportExtensions(Revit.GeometryConversion)

clr.AddReference("System")
from System.Collections.Generic import List

beamElements = UnwrapElement(IN[0])
pts = UnwrapElement(IN[1])

beamLocations = []

for beam in beamElements:
	beamLocations.append(beam.Location)

newBeamLine = []

TransactionManager.Instance.EnsureInTransaction(doc)

for i in range(0,len(beamLocations)):
	newBeamLine = Line.CreateBound(pts[i][0].ToXyz(), pts[i][1].ToXyz())
	#Change the beam location line to a new line:
	beamLocations[i].Curve = newBeamLine;

            

TransactionManager.Instance.TransactionTaskDone()

OUT = beamElements
# ----------------------------------------
select_model_elements = DSModelElementsSelection()  # 2 picked in the model
code_block = CodeBlock(a=select_model_elements) { {a}; }
code_block_2 = CodeBlock { 700; }
python_script_3 = Python(IN[0]=select_model_elements, IN[1]=code_block_2)
# ---------- python_script_3.python (55 lines) ----------
import clr

clr.AddReference('RevitAPI')
import Autodesk
from Autodesk.Revit.DB import *

clr.AddReference("RevitNodes")
import Revit
clr.ImportExtensions(Revit.Elements)
clr.ImportExtensions(Revit.GeometryConversion)

clr.AddReference("RevitServices")
from RevitServices.Persistence import DocumentManager
from RevitServices.Transactions import TransactionManager

doc = DocumentManager.Instance.CurrentDBDocument

getDocUnits = doc.GetUnits()
getDisplayUnits = getDocUnits.GetFormatOptions(UnitType.UT_Length).DisplayUnits


def ToInternalUnits(number):
	return UnitUtils.ConvertToInternalUnits(number, getDisplayUnits)

def translateBeamStartPoint(beam, offset):
	point = beam.Location.Curve.GetEndPoint(0)
	newPoint = XYZ(point.X, point.Y, point.Z - ToInternalUnits(offset))
	return newPoint

def translateBeamEndPoint(beam, offset):
	point = beam.Location.Curve.GetEndPoint(1)
	newPoint = XYZ(point.X, point.Y, point.Z - ToInternalUnits(offset))
	return newPoint

def beamStartPoint(beam):
	return beam.Location.Curve.GetEndPoint(0)

def beamEndPoint(beam):
	return beam.Location.Curve.GetEndPoint(1)


beams = UnwrapElement(IN[0])

offset = IN[1]


TransactionManager.Instance.EnsureInTransaction(doc)

for b in beams:
	b.Location.Curve = Line.CreateBound(translateBeamStartPoint(b,offset), beamEndPoint(b))
	
TransactionManager.Instance.TransactionTaskDone()


OUT = beams
# ----------------------------------------
python_script_4 = Python()  # unwired: IN[0]
# ---------- python_script_4.python (6 lines) ----------
import clr
clr.AddReference('RevitAPI')
import Autodesk
from Autodesk.Revit.DB import *

OUT = Line.CreateBound(IN[0][0], IN[0][1])
# ----------------------------------------
select_model_elements_2 = DSModelElementsSelection()  # 1 picked in the model
python_script_5 = Python(IN[0]=select_model_elements_2, IN[1]=code_block_2)
# ---------- python_script_5.python (47 lines) ----------
import clr

clr.AddReference('RevitAPI')
import Autodesk
from Autodesk.Revit.DB import *

clr.AddReference("RevitNodes")
import Revit
clr.ImportExtensions(Revit.Elements)
clr.ImportExtensions(Revit.GeometryConversion)

clr.AddReference("RevitServices")
from RevitServices.Persistence import DocumentManager
from RevitServices.Transactions import TransactionManager

doc = DocumentManager.Instance.CurrentDBDocument

getDocUnits = doc.GetUnits()
getDisplayUnits = getDocUnits.GetFormatOptions(UnitType.UT_Length).DisplayUnits


def ToInternalUnits(number):
	return UnitUtils.ConvertToInternalUnits(number, getDisplayUnits)

def translateBeamStartPoint(beam, offset):
	point = beam.Location.Curve.GetEndPoint(0)
	newPoint = XYZ(point.X, point.Y, point.Z - ToInternalUnits(offset))
	return newPoint

def translateBeamEndPoint(beam, offset):
	point = beam.Location.Curve.GetEndPoint(1)
	newPoint = XYZ(point.X, point.Y, point.Z - ToInternalUnits(offset))
	return newPoint

def beamStartPoint(beam):
	return beam.Location.Curve.GetEndPoint(0)

def beamEndPoint(beam):
	return beam.Location.Curve.GetEndPoint(1)


beams = UnwrapElement(IN[0])

offset = IN[1]


OUT = translateBeamStartPoint(beams,offset), beamEndPoint(beams)
# ----------------------------------------
python_script_6 = Python(IN[0]=python_script_5)
# ---------- python_script_6.python (17 lines) ----------
import clr
clr.AddReference('ProtoGeometry')
from Autodesk.DesignScript.Geometry import *
#The inputs to this node will be stored as a list in the IN variables.
import clr
clr.AddReference("RevitNodes")
import Revit
# Import ToProtoType, ToRevitType geometry conversion extension methods
clr.ImportExtensions(Revit.GeometryConversion)


pts = IN[0]



#Assign your output to the OUT variable.
OUT = [p.ToPoint() for p in pts]
# ----------------------------------------
python_script_7 = Python(IN[0]=select_model_elements, IN[1]=code_block_2)  # same code as python_script_5
python_script_8 = Python(IN[0]=python_script_7)  # same code as python_script_6
