# Dynamo graph nervi03.dyn (Dynamo 1.3.1.1736)

intersectAll = Geometry.IntersectAll(lacing=CrossProduct)  # unwired: geometry, others
flatten = Flatten(intersectAll@L3)
split = Geometry.Split()  # unwired: geometry, other
getItemAtIndex = List.GetItemAtIndex()  # unwired: list, index
geometrySplit = Geometry.Intersection.GeometrySplit()  # unwired: arg0, arg1
code_block = CodeBlock(a=geometrySplit) { a[0]; }
flatten_2 = Flatten(code_block)
perimeterCurves = Surface.PerimeterCurves(flatten_2)
code_block_2 = CodeBlock { 0; }
getItemAtIndex_2 = List.GetItemAtIndex(list=perimeterCurves, index=code_block_2, lacing=Longest)
code_block_3 = CodeBlock { 2; }
getItemAtIndex_3 = List.GetItemAtIndex(list=perimeterCurves, index=code_block_3, lacing=Longest)
number_slider = DoubleSlider(30, range=0..100 step 0.1)
byCenterPointRadius = Circle.ByCenterPointRadius(radius=number_slider)
endPoint = Curve.EndPoint(byCenterPointRadius)
number_slider_2 = DoubleSlider(24, range=0..100 step 0.1)
byCenterPointRadius_2 = Circle.ByCenterPointRadius(radius=number_slider_2)
ZAxis = Vector.ZAxis()
number_slider_3 = DoubleSlider(4, range=0..100 step 0.1)
translate = Geometry.Translate(geometry=byCenterPointRadius_2, direction=ZAxis, distance=number_slider_3)
endPoint_2 = Curve.EndPoint(translate)
number_slider_4 = DoubleSlider(12, range=0..100 step 0.1)
byCenterPointRadius_3 = Circle.ByCenterPointRadius(radius=number_slider_4)
ZAxis_2 = Vector.ZAxis()
number_slider_5 = DoubleSlider(8, range=0..100 step 0.1)
translate_2 = Geometry.Translate(geometry=byCenterPointRadius_3, direction=ZAxis_2, distance=number_slider_5)
endPoint_3 = Curve.EndPoint(translate_2)
byThreePoints = Arc.ByThreePoints(firstPoint=endPoint, secondPoint=endPoint_2, thirdPoint=endPoint_3)
bySweep = Surface.BySweep(byThreePoints, byCenterPointRadius)
code_block_4 = CodeBlock { {0,1}; }
code_block_5 = CodeBlock { {0..1..#54,0..1..#2}; }
getIsoline = Surface.GetIsoline(bySweep, code_block_4, code_block_5)
code_block_6 = CodeBlock(a=getIsoline) { a[0]; }
code_block_7 = CodeBlock { 0..1..#6; }
pointAtParameter = Curve.PointAtParameter(curve=code_block_6, param=code_block_7, lacing=CrossProduct)
code_block_8 = CodeBlock { {true,false}; }
count = List.Count(pointAtParameter, lacing=Longest)
cycle = List.Cycle(list=code_block_8, amount=count)
filterByBoolMask = List.FilterByBoolMask(list=pointAtParameter, mask=cycle)
code_block_9 = CodeBlock(a=filterByBoolMask.in) { a; }
code_block_10 = CodeBlock { 1; }
shiftIndices = List.ShiftIndices(list=code_block_9, amount=code_block_10)
code_block_11 = CodeBlock(b=filterByBoolMask.out) { b; }
byStartPointEndPoint = Line.ByStartPointEndPoint(startPoint=shiftIndices, endPoint=code_block_11, lacing=Longest)
shiftIndices_2 = List.ShiftIndices(list=code_block_11, amount=code_block_10)
byStartPointEndPoint_2 = Line.ByStartPointEndPoint(startPoint=code_block_9, endPoint=shiftIndices_2)
pointAtParameter_2 = Curve.PointAtParameter(curve=code_block_6, param=code_block_7, lacing=CrossProduct)
