# Dynamo graph nervi06.dyn (Dynamo 1.3.2.2480)

number_slider = DoubleSlider(39, range=0..100 step 0.1)

# group: circle5
byCenterPointRadius = Circle.ByCenterPointRadius(radius=number_slider)

ZAxis = Vector.ZAxis()
number_slider_2 = DoubleSlider(-6, range=-6..100 step 0.1)

# group: move circle5
translate = Geometry.Translate(geometry=byCenterPointRadius, direction=ZAxis, distance=number_slider_2)

code_block = CodeBlock { 36; }
divideCurve = Geometry.Curves.DivideCurve(translate, code_block)
number_slider_3 = DoubleSlider(35, range=0..100 step 0.1)

# group: circle6
byCenterPointRadius_2 = Circle.ByCenterPointRadius(radius=number_slider_3)

ZAxis_2 = Vector.ZAxis()
number_slider_4 = DoubleSlider(-3, range=-3..100 step 0.1)

# group: move circle6
translate_2 = Geometry.Translate(geometry=byCenterPointRadius_2, direction=ZAxis_2, distance=number_slider_4)

divideCurve_2 = Geometry.Curves.DivideCurve(translate_2, code_block)

# group: columns
byStartPointEndPoint = Line.ByStartPointEndPoint(startPoint=divideCurve, endPoint=divideCurve_2)

number_slider_5 = DoubleSlider(33, range=0..100 step 0.1)

# group: circle7
byCenterPointRadius_3 = Circle.ByCenterPointRadius(radius=number_slider_5)

ZAxis_3 = Vector.ZAxis()
number_slider_6 = DoubleSlider(-1, range=-3..100 step 0.1)

# group: move circle7
translate_3 = Geometry.Translate(geometry=byCenterPointRadius_3, direction=ZAxis_3, distance=number_slider_6)

code_block_2 = CodeBlock { 72; }
divideCurve_3 = Geometry.Curves.DivideCurve(translate_3, code_block_2)
distanceTo = Geometry.DistanceTo(geometry=divideCurve_2, other=divideCurve_3, lacing=CrossProduct)
code_block_3 = CodeBlock { 1; }
round = Math.Round(number=distanceTo, digits=code_block_3)
code_block_4 = CodeBlock(a=round) { a[0][1]; }
allIndicesOf = List.AllIndicesOf(list=round, item=code_block_4, lacing=Longest)
getItemAtIndex = List.GetItemAtIndex(list=divideCurve_3, index=allIndicesOf)

# group: 2 branches
byStartPointEndPoint_2 = Line.ByStartPointEndPoint(startPoint=divideCurve_2, endPoint=getItemAtIndex)

number_slider_7 = DoubleSlider(30, range=0..100 step 0.1)

# group: circle1
byCenterPointRadius_4 = Circle.ByCenterPointRadius(radius=number_slider_7)

# group: number of ribs
code_block_5 = CodeBlock { 54; }

divideCurve_4 = Geometry.Curves.DivideCurve(byCenterPointRadius_4, code_block_5)
number_slider_8 = DoubleSlider(24, range=0..100 step 0.1)

# group: circle2
byCenterPointRadius_5 = Circle.ByCenterPointRadius(radius=number_slider_8)

ZAxis_4 = Vector.ZAxis()
number_slider_9 = DoubleSlider(25.4, range=0..100 step 0.1)

# group: move circle2
translate_4 = Geometry.Translate(geometry=byCenterPointRadius_5, direction=ZAxis_4, distance=number_slider_9)

divideCurve_5 = Geometry.Curves.DivideCurve(translate_4, code_block_5)
number_slider_10 = DoubleSlider(12, range=0..100 step 0.1)

# group: circle3
byCenterPointRadius_6 = Circle.ByCenterPointRadius(radius=number_slider_10)

ZAxis_5 = Vector.ZAxis()
number_slider_11 = DoubleSlider(39.9, range=0..100 step 0.1)

# group: move circle3
translate_5 = Geometry.Translate(geometry=byCenterPointRadius_6, direction=ZAxis_5, distance=number_slider_11)

divideCurve_6 = Geometry.Curves.DivideCurve(translate_5, code_block_5)
byThreePoints = Arc.ByThreePoints(firstPoint=divideCurve_4, secondPoint=divideCurve_5, thirdPoint=divideCurve_6)
code_block_6 = CodeBlock { 0..1..#8; }
pointAtParameter = Curve.PointAtParameter(curve=byThreePoints, param=code_block_6, lacing=CrossProduct)
pointAtParameter_2 = Curve.PointAtParameter(curve=byThreePoints, param=code_block_6, lacing=CrossProduct)
code_block_7 = CodeBlock { 1; }
shiftIndices = List.ShiftIndices(list=pointAtParameter_2, amount=code_block_7)
code_block_8 = CodeBlock { 1; }
dropItems = List.DropItems(list=shiftIndices, amount=code_block_8, lacing=Longest)
byStartPointEndPoint_3 = Line.ByStartPointEndPoint(startPoint=pointAtParameter, endPoint=dropItems)
code_block_9 = CodeBlock { 0; }
removeItemAtIndex = List.RemoveItemAtIndex(list=byStartPointEndPoint_3, indices=code_block_9)
lime = Custom[Color.Lime]()  # Returns the colour lime.
byGeometryColor = Display.Display.ByGeometryColor(removeItemAtIndex, lime)
code_block_10 = CodeBlock(a=divideCurve_4) { a; }
flatten = Flatten(getItemAtIndex)
pruneDuplicates = Point.PruneDuplicates(points=flatten)
distanceTo_2 = Geometry.DistanceTo(geometry=pruneDuplicates, other=code_block_10, lacing=CrossProduct)
code_block_11 = CodeBlock { 2; }
round_2 = Math.Round(number=distanceTo_2, digits=code_block_11)
code_block_12 = CodeBlock { 5; }
lt = round_2 < code_block_12  # lacing=Longest
code_block_13 = CodeBlock { true; }
allIndicesOf_2 = List.AllIndicesOf(list=lt, item=code_block_13, lacing=Longest)
getItemAtIndex_2 = List.GetItemAtIndex(list=code_block_10, index=allIndicesOf_2)

# group: 4 branches
byStartPointEndPoint_4 = Line.ByStartPointEndPoint(startPoint=getItemAtIndex_2, endPoint=pruneDuplicates)

teal = Custom[Color.Teal]()  # Returns the colour teal.
byGeometryColor_2 = Display.Display.ByGeometryColor(byStartPointEndPoint_4, teal)
code_block_14 = CodeBlock { 2; }
shiftIndices_2 = List.ShiftIndices(list=pointAtParameter, amount=code_block_14)
byStartPointEndPoint_5 = Line.ByStartPointEndPoint(startPoint=shiftIndices_2, endPoint=dropItems)
code_block_15 = CodeBlock { 1; }
removeItemAtIndex_2 = List.RemoveItemAtIndex(list=byStartPointEndPoint_5, indices=code_block_15)
purple = Custom[Color.Purple]()  # Returns the colour purple.
byGeometryColor_3 = Display.Display.ByGeometryColor(removeItemAtIndex_2, purple)
number_slider_12 = DoubleSlider(8, range=0..100 step 0.1)

# group: circle4
byCenterPointRadius_7 = Circle.ByCenterPointRadius(radius=number_slider_12)

ZAxis_6 = Vector.ZAxis()
number_slider_13 = DoubleSlider(44, range=-6..100 step 0.1)

# group: move circle4
translate_6 = Geometry.Translate(geometry=byCenterPointRadius_7, direction=ZAxis_6, distance=number_slider_13)

# group: oculus beams
code_block_16 = CodeBlock { 54; }

divideCurve_7 = Geometry.Curves.DivideCurve(translate_6, code_block_16)

# group: oculus
byStartPointEndPoint_6 = Line.ByStartPointEndPoint(startPoint=divideCurve_6, endPoint=divideCurve_7)

fuchsia = Custom[Color.Fuchsia]()  # Returns the colour fuchsia a.k.a. magenta.
byGeometryColor_4 = Display.Display.ByGeometryColor(byStartPointEndPoint_6, fuchsia)

# group: diagonals
join = List.Join(removeItemAtIndex, removeItemAtIndex_2)

flatten_2 = Flatten(join)
levels = Levels("00")
structural_framing_types = StructuralFramingTypes("SHS150x150x10")
beamByCurve = StructuralFraming.BeamByCurve(curve=flatten_2, level=levels, structuralFramingType=structural_framing_types)
structural_framing_types_2 = StructuralFramingTypes("CHS219.1x10")
beamByCurve_2 = StructuralFraming.BeamByCurve(curve=byStartPointEndPoint_6, level=levels, structuralFramingType=structural_framing_types_2)
