# Dynamo graph nodeToCodeToMacro.dyn (Dynamo 2.0.1.4955)

categories = Categories(index=437)
all_elements_of_category = ElementsOfCategory(Category=categories)
delete = archilab.Revit.Elements.Elements.Delete(element=all_elements_of_category)  # frozen
python_script = Python()  # frozen; unwired: IN[0]
# ---------- python_script.python (39 lines) ----------
import clr

clr.AddReference('RevitAPI')
from Autodesk.Revit.DB import *
from Autodesk.Revit.DB.Structure import *

clr.AddReference('RevitAPIUI')
from Autodesk.Revit.UI import *

clr.AddReference('System')
from System.Collections.Generic import List

clr.AddReference('RevitNodes')
import Revit
clr.ImportExtensions(Revit.GeometryConversion)
clr.ImportExtensions(Revit.Elements)

clr.AddReference('RevitServices')
import RevitServices
from RevitServices.Persistence import DocumentManager
from RevitServices.Transactions import TransactionManager

doc = DocumentManager.Instance.CurrentDBDocument
uidoc=DocumentManager.Instance.CurrentUIApplication.ActiveUIDocument

#Preparing input from dynamo to revit
sheets = FilteredElementCollector(doc).OfClass(ViewSheet).ToElements()

#Do some action in a Transaction
TransactionManager.Instance.EnsureInTransaction(doc)

try:
	for s in sheets:
		doc.Delete(s.Id)
	OUT = "Completed"
except:
	OUT = "Cannot delete all sheets"
	
TransactionManager.Instance.TransactionTaskDone()
# ----------------------------------------
