# Dynamo graph nodeUI.dyn (Dynamo 1.3.1.1736)

code_block = CodeBlock { "Test1"; }
code_block_2 = CodeBlock { {"a","b","c"}; }
code_block_3 = CodeBlock { 2; }
ui_dropdown_data = Custom[UI.DropDown Data](InputName=code_block, Keys=code_block_2, Values=code_block_2, DefaultValueIndex=code_block_3)  # Create data for DropDown input in UI.MultiInputForm ++ . Check out www.data-shapes.net for more infos.
code_block_4 = CodeBlock { "Test2"; }
ui_dropdown_data_2 = Custom[UI.DropDown Data](InputName=code_block_4, Keys=code_block_2, Values=code_block_2)
code_block_5 = CodeBlock { "Diameter"; }
code_block_6 = CodeBlock { "Enter diameter"; }
ui_textbox_data = Custom[UI.TextBox Data](InputName=code_block_5, DefaultText=code_block_6)  # Create Data for TextBox input in UI.MultipleInputForm ++ . Check out www.data-shapes.net for more informations
create = List.Create(ui_dropdown_data, ui_dropdown_data_2, ui_textbox_data)
flatten = Flatten(create)
boolean = BoolSelector(true)
ui_multipleinputform = Custom[UI.MultipleInputForm ++](Inputs=flatten, Toggle=boolean)  # Create a form with multiple inputs. see www.data-shapes.net for tutorials and infos!
