# Dynamo graph parseBluebeamMarkups.dyn (Dynamo 2.1.0.6255)

categories = Categories(index=422)
all_elements_of_category = ElementsOfCategory(Category=categories)
sheetNumber = Sheet.SheetNumber(sheet=all_elements_of_category)
file_path = Filename("..\Desktop\TXT\20181004_CCI Core Elevs-Control box penos-DY&PS02 - Copy.txt")  # graph input
readText = FileSystem.ReadText(file=file_path)
code_block = CodeBlock { "\n"; }
split = String.Split(str=readText, separater0=code_block)
code_block_2 = CodeBlock { "S1-"; }
startsWith = String.StartsWith(str=split, searchFor=code_block_2)
filterByBoolMask = List.FilterByBoolMask(list=split, mask=startsWith)
uniqueItems = List.UniqueItems(list=filterByBoolMask.in)
sort = List.Sort(list=uniqueItems)
code_block_3 = CodeBlock { 0; 3; }
remove = String.Remove(str=sort, startIndex=code_block_3.out0, count=code_block_3.out1)
allIndicesOf = List.AllIndicesOf(list=sheetNumber, item=remove)
getItemAtIndex = List.GetItemAtIndex(list=all_elements_of_category, index=allIndicesOf)
flatten = List.Flatten(list=getItemAtIndex)
code_block_4 = CodeBlock { "181005"; }

# group: Springs package
byViewsName = Custom[Springs.ViewSet.ByViewsName](views=flatten, setName=code_block_4)  # frozen; Creates a set of views(or sheets) for printing. If the set exists, set Overwrite to true to replace it.

code_block_5 = CodeBlock { "S1-"; }
python_script = Python(IN[0]=code_block_5, IN[1]=readText)
# ---------- python_script.python (15 lines) ----------
c = IN[0]

text = IN[1]


newText = text.split("\n")

result = []

for n in newText:
	if n.startswith(c):
		result.append(n[:-1])
		

OUT = set(sorted(result))
# ----------------------------------------
