# Dynamo graph pdfSet_v08 - Copy.dyn (Dynamo 0.8.2.2392)

# group: GET SHEET NUMBER FROM PDF
string = StringInput("M-BAR-1F4TS0-CB00-EDR-(.*)")
string_2 = StringInput("C:\Users\giovanni.brogiolo\Desktop\2017-11-24_TK lift comments and more.txt")
readText = File.ReadText(string_2)
findRegularExpression = Custom[String.FindRegularExpression](RegEx=string, str=readText)  # Returns all occurences of a regular expression within a string (or list of strings). The syntax for regular expressions is explained at http://ironpython-test.readthedocs.org/en/latest/howto/regex.html
uniqueItems = List.UniqueItems()
toNumber = String.ToNumber(uniqueItems)
code_block = CodeBlock { 1000; }
gt = toNumber > code_block
filterByBoolMask = List.FilterByBoolMask(list=uniqueItems, mask=gt)

trimWhitespace = String.TrimWhitespace(filterByBoolMask.in)

# group: SET TITLEBLOCK ISSUE DATE
categories = Categories("TitleBlocks")
all_elements_of_category = ElementsOfCategory(categories)
code_block_2 = CodeBlock { "Sheet Number"; }
getParameterValueByName = Element.GetParameterValueByName(element=all_elements_of_category, parameterName=code_block_2)
code_block_3 = CodeBlock(item=trimWhitespace) { item; }
allIndicesOf = List.AllIndicesOf(list=getParameterValueByName, item=code_block_3)
flatten = Flatten(allIndicesOf)
getItemAtIndex = List.GetItemAtIndex(list=all_elements_of_category, index=flatten)
code_block_4 = CodeBlock { "Sheet Issue Date"; }
code_block_5 = CodeBlock { "2017 December 15"; }
setParameterByName = Element.SetParameterByName(element=getItemAtIndex, parameterName=code_block_4, value=code_block_5, lacing=Longest)

# group: SELECT THE CLOUDS ON THE SHEETS
categories_2 = Categories("RevisionClouds")
all_elements_of_category_2 = ElementsOfCategory(categories_2)
ownerView = Custom[Element.OwnerView](element=all_elements_of_category_2)  # Gets the owner view of a given Revit element (if possible)
code_block_6 = CodeBlock { "Sheet Number"; }
getParameterValueByName_2 = Element.GetParameterValueByName(element=ownerView, parameterName=code_block_6)
code_block_7 = CodeBlock(item=trimWhitespace) { item; }
allIndicesOf_2 = List.AllIndicesOf(list=getParameterValueByName_2, item=code_block_7)
flatten_2 = Flatten(allIndicesOf_2)
getItemAtIndex_2 = List.GetItemAtIndex(list=all_elements_of_category_2, index=flatten_2)

# group: SELECT THE REVISION CLOUDS FOR THE CURRENT ISSUE
code_block_8 = CodeBlock { "Revision Date"; }
getParameterValueByName_3 = Element.GetParameterValueByName(element=getItemAtIndex_2, parameterName=code_block_8)
code_block_9 = CodeBlock { "15/12/2017"; }
contains = String.Contains(str=getParameterValueByName_3, searchFor=code_block_9)
filterByBoolMask_2 = List.FilterByBoolMask(list=getItemAtIndex_2, mask=contains)
code_block_10 = CodeBlock(a=filterByBoolMask_2.in) { a; }

ownerView_2 = Custom[Element.OwnerView](element=code_block_10)
sheetNumber = Sheet.SheetNumber(ownerView_2)

# group: MATCH REVISION CLOUD TO SHEET REVISION AND VERSION
setParameterByName_2 = Element.SetParameterByName(element=code_block_10)
code_block_11 = CodeBlock { {"Comments","Mark"}; }
code_block_12 = CodeBlock { {"TB_Revision","TB_Version"}; }
getParameterValueByName_4 = Element.GetParameterValueByName(element=ownerView_2, parameterName=code_block_12, lacing=CrossProduct)
code_block_13 = CodeBlock { "v"; }
code_block_14 = CodeBlock { ""; }
replace = String.Replace(str=getParameterValueByName_4, searchFor=code_block_13, replaceWith=code_block_14)
transpose = List.Transpose(replace)
combine = List.Combine(setParameterByName_2, code_block_11, transpose)
