# Dynamo graph pipeSegments.dyn (Dynamo 2.0.1.4955)

python_script = Python()  # unwired: IN[0]
# ---------- python_script.python (47 lines) ----------
import clr

clr.AddReference('RevitAPI')
from Autodesk.Revit.DB import *
from Autodesk.Revit.DB.Structure import *
from Autodesk.Revit.DB.Plumbing import *

clr.AddReference('RevitAPIUI')
from Autodesk.Revit.UI import *

clr.AddReference('System')
from System.Collections.Generic import List

clr.AddReference('RevitNodes')
import Revit
clr.ImportExtensions(Revit.GeometryConversion)
clr.ImportExtensions(Revit.Elements)

clr.AddReference('RevitServices')
import RevitServices
from RevitServices.Persistence import DocumentManager
from RevitServices.Transactions import TransactionManager

doc = DocumentManager.Instance.CurrentDBDocument
uidoc=DocumentManager.Instance.CurrentUIApplication.ActiveUIDocument

#Preparing input from dynamo to revit
element = UnwrapElement(IN[0])

#Do some action in a Transaction
TransactionManager.Instance.EnsureInTransaction(doc)

TransactionManager.Instance.TransactionTaskDone()


settings = PipeSettings.GetPipeSettings( doc )

segments = FilteredElementCollector(doc).OfClass(Segment);

#result = FilteredElementCollector(doc).OfCategory(BuiltInCategory.OST_PipeSegments)

names = []

for s in segments:
	names.append(s.Name)

OUT = names, segments
# ----------------------------------------
code_block = CodeBlock(a=python_script) { a[1][7]; }
python_script_2 = Python(IN[0]=code_block)
# ---------- python_script_2.python (32 lines) ----------
import clr

clr.AddReference('RevitAPI')
from Autodesk.Revit.DB import *
from Autodesk.Revit.DB.Structure import *
from Autodesk.Revit.DB.Plumbing import *

clr.AddReference('RevitAPIUI')
from Autodesk.Revit.UI import *

clr.AddReference('System')
from System.Collections.Generic import List

clr.AddReference('RevitNodes')
import Revit
clr.ImportExtensions(Revit.GeometryConversion)
clr.ImportExtensions(Revit.Elements)

clr.AddReference('RevitServices')
import RevitServices
from RevitServices.Persistence import DocumentManager
from RevitServices.Transactions import TransactionManager

doc = DocumentManager.Instance.CurrentDBDocument
uidoc=DocumentManager.Instance.CurrentUIApplication.ActiveUIDocument

#Preparing input from dynamo to revit
element = UnwrapElement(IN[0])

sizes = element.GetSizes()

OUT = [s.NominalDiameter for s in sizes]
# ----------------------------------------
code_block_2 = CodeBlock(a=python_script) { a[0]; }
code_block_3 = CodeBlock { 0; }
watch = Custom[Springs.Watch+](input=code_block_2, addIndexes=code_block_3)  # This node that serializes the input information and presents it in a resizable text window.
