# Dynamo graph placeCastInPlates.dyn (Dynamo 1.3.2.2480)

select_model_element = DSModelElementSelection()  # 1 picked in the model
location = StructuralFraming.Location(select_model_element)
startPoint = Curve.StartPoint(location)
family_types = FamilyTypes("DesignCheck_CastInPlate_RevitFamily:2x2 Studs, 2xB16 Anchors")
endPoint = Curve.EndPoint(location)
code_block = CodeBlock { "Reference Level"; }
getParameterValueByName = Element.GetParameterValueByName(element=select_model_element, parameterName=code_block)
byPointAndLevel = FamilyInstance.ByPointAndLevel(familyType=family_types, point=endPoint, level=getParameterValueByName)
code_block_2 = CodeBlock { "Offset"; }
code_block_3 = CodeBlock { 0; }
setParameterByName = Element.SetParameterByName(element=byPointAndLevel, parameterName=code_block_2, value=code_block_3)
