# Dynamo graph placeWindows03.dyn (Dynamo 1.3.1.1736)

# group: from Bakery
get_loaded_rvt_links = Custom[Get Loaded RVT Links]()

categories = Categories("Windows")

# group: from SteamNodes
getFromLinkedFile = Custom[Element.GetFromLinkedFile](Link_Instance=get_loaded_rvt_links.loaded_Link_Names, Link_Document=get_loaded_rvt_links.loaded_Link_Docs, Category=categories)  # Get elements from link document instance based on category

name = Element.Name()  # unwired: arg0
groupByFunction = GroupByFunction(getFromLinkedFile, name)
code_block = CodeBlock(a=groupByFunction) { a[49]; }

# group: Extract windows void width and height
code_block_2 = CodeBlock { {"Width","Height"}; }
getParameterValueByName = Element.GetParameterValueByName(element=code_block, parameterName=code_block_2, lacing=CrossProduct)
code_block_3 = CodeBlock { 0; }
round = Math.Round(number=getParameterValueByName, digits=code_block_3)

categories_2 = Categories("Walls")
all_elements_of_category = ElementsOfCategory(categories_2)
family_types = FamilyTypes("Family1:Family1")

# group: Extract windows void locations
location = FamilyInstance.Location(code_block)

byPoint = FamilyInstance.ByPoint(familyType=family_types, point=location)
code_block_4 = CodeBlock { 0; }
getSurroundingElements = Custom[Tool.GetSurroundingElements](Element=all_elements_of_category, ElementCheck=byPoint, Tolerance=code_block_4)  # Get Surrounding Elements by Categories, group them as List. Tolerance distance available.
deconstruct = List.Deconstruct(list=getSurroundingElements, lacing=Longest)
family_types_2 = FamilyTypes("Window_void:void")
location_2 = FamilyInstance.Location(deconstruct.rest, lacing=Longest)
byPoints = Custom[Springs.HostedInstance.ByPoints](host=deconstruct.first, type=family_types_2, point=location_2, lacing=Longest)  # Creates hosted family instances(doors/windows) at the specified points. You can feed either a single family type or a unique type for each instance.
flatten = Flatten(byPoints)
code_block_5 = CodeBlock { {3040,2600}; }

# group: Set void width and height
code_block_6 = CodeBlock { {"Void_height","Void_Width"}; }
setParameterByName = Element.SetParameterByName(element=flatten, parameterName=code_block_6, value=code_block_5, lacing=CrossProduct)
