# Dynamo graph placeWindows08.dyn (Dynamo 1.3.1.1736)

# group: SELECT STRUCTURAL WALLS
select_model_elements = DSModelElementsSelection()  # 3 picked in the model

# group: EXTRACT WINDOWS FROM LINKED FILE
get_linked_rvt_documents = Custom[Get Linked RVT Documents]()
categories = Categories("CurtainWallPanels")
linkedInstanceElements = Custom[Springs.Collector.LinkedInstanceElements](LinkInstance=get_linked_rvt_documents.Link_Instance, category=categories)  # Extract elements by category from the selected linked instances. The transform vector can be used to get the exact location of the elements in the local file

# group: FILTER THE CURTAIN PANELS WHICH HAVE NESTED VOIDS
subComponents = Custom[FamilyInstance.SubComponents](familyInstance=linkedInstanceElements.elements)  # Retrieves all subcomponents of a given family instance
isEmpty = List.IsEmpty(subComponents, lacing=Longest)
filterByBoolMask = List.FilterByBoolMask(list=linkedInstanceElements.elements, mask=isEmpty)

# group: INTERSECT WINDOWS WITH WALLS (BIMORPH NODE)
boundingBox = Geometry.BoundingBox(select_model_elements, lacing=Longest)
code_block = CodeBlock { 1; }
getElementsIntersect = Revit.BoundingBox.GetElementsIntersect(boundingBox, filterByBoolMask.out, code_block)

subComponents_2 = Custom[FamilyInstance.SubComponents](familyInstance=getElementsIntersect, lacing=Longest)
flatten = Flatten(subComponents_2@L3)

# group: FIND ARCH WINDOWS LOCATION POINTS AND PLACE OPENING
family_types = FamilyTypes("Window_void:void")
location = Custom[Element.Location](element=flatten, lacing=Longest)  # Returns the location of an element as an XYZ (or if it's line-based the start and end point of the line), along with some booleans to help filtering the results. Use this for some element types (e.g. walls or lines) that do not work with the built-in Get Family Instance Location node.

flatten_2 = Flatten(location.points@L2)

# group (continued): FIND ARCH WINDOWS LOCATION POINTS AND PLACE OPENING
byPoints = Custom[Springs.HostedInstance.ByPoints](host=select_model_elements, type=family_types, point=flatten_2, lacing=Longest)  # Creates hosted family instances(doors/windows) at the specified points. You can feed either a single family type or a unique type for each instance.

# group: GET ARCHITECTS'S WINDOWS WIDTH AND HEIGHT
code_block_2 = CodeBlock { {"Width","Height"}; }
getParameterValueByName = Element.GetParameterValueByName(element=flatten, parameterName=code_block_2, lacing=CrossProduct)
code_block_3 = CodeBlock { 0; }
round = Math.Round(number=getParameterValueByName, digits=code_block_3)

# group: SET OPENING WIDTH AND HEIGHT
code_block_4 = CodeBlock { "Void_Width"; }
code_block_5 = CodeBlock { 0; }
getItemAtIndex = List.GetItemAtIndex(list=round, index=code_block_5, lacing=Longest)
setParameterByName = Element.SetParameterByName(element=byPoints, parameterName=code_block_4, value=getItemAtIndex, lacing=Longest)
code_block_6 = CodeBlock { "Void_height"; }
code_block_7 = CodeBlock { 1; }
getItemAtIndex_2 = List.GetItemAtIndex(list=round, index=code_block_7, lacing=Longest)
setParameterByName_2 = Element.SetParameterByName(element=byPoints, parameterName=code_block_6, value=getItemAtIndex_2, lacing=Longest)

code_block_8 = CodeBlock(Walls=select_model_elements) { Walls; }
