# Dynamo graph projectBeams_v08.dyn (Dynamo 0.8.2.2392)

select_model_elements = DSModelElementsSelection()  # 19 picked in the model
location = StructuralFraming.Location(select_model_elements)
select_face = DSFaceSelection()
ZAxis = Vector.ZAxis()
project = Curve.Project(curve=location, baseGeometry=select_face, projectionDirection=ZAxis, lacing=Longest)
flatten = Flatten(project)
startPoint = Curve.StartPoint(flatten)
endPoint = Curve.EndPoint(flatten)
python_script = Python(IN[0]=select_model_elements, IN[1]=startPoint, IN[2]=endPoint)
# ---------- python_script.python (44 lines) ----------
import clr

clr.AddReference("RevitServices")
import RevitServices
from RevitServices.Persistence import DocumentManager
from RevitServices.Transactions import TransactionManager
doc = DocumentManager.Instance.CurrentDBDocument

clr.AddReference("RevitAPI")
import Autodesk
from Autodesk.Revit.DB import *

clr.AddReference("RevitNodes")
import Revit
clr.ImportExtensions(Revit.Elements)
clr.ImportExtensions(Revit.GeometryConversion)

clr.AddReference("System")
from System.Collections.Generic import List

beamElement = UnwrapElement(IN[0])
#nBl = UnwrapElement(IN[1])
stPt = UnwrapElement(IN[1])
endPt = UnwrapElement(IN[2])



TransactionManager.Instance.EnsureInTransaction(doc)

#p1 = XYZ.Zero
#p2 = XYZ(10, 20, 0)

for i in range(0,len(stPt)):
	beamLine = beamElement[i].Location
	p1 = stPt[i].ToXyz()
	p2 = endPt[i].ToXyz()
	newBeamLine = Line.CreateBound(p1, p2)
	beamLine.Curve = newBeamLine;

            

TransactionManager.Instance.TransactionTaskDone()

OUT = beamElement
# ----------------------------------------
code_block = CodeBlock { {a}; }
