# Dynamo graph pythonToDynamo.dyn (Dynamo 1.3.2.2480)

code_block = CodeBlock { 10000; }
python_script = Python(IN[0]=code_block)
# ---------- python_script.python (11 lines) ----------
from System.Diagnostics import Stopwatch

sw = Stopwatch.StartNew()

a = 0

for i in range(0,IN[0]):
	a += 1

#Assign your output to the OUT variable.
OUT = a, sw.Elapsed.TotalMilliseconds
# ----------------------------------------
code_block_2 = CodeBlock { 5; }
code_block_3 = CodeBlock { 3; }
code_block_4 = CodeBlock { 4; }
create = List.Create(code_block_3, code_block_4)
add = code_block_2 + create
code_block_5 = CodeBlock(a=code_block_2) { {a,8}; }
python_script_2 = Python(IN[0]=code_block_5, IN[1]=create)
# ---------- python_script_2.python (22 lines) ----------
import clr
clr.AddReference('ProtoGeometry')
from Autodesk.DesignScript.Geometry import *


x = IN[0]
y = IN[1]

#sum1 = x+y[0]

#sum2 = x+y[1]

#sum = [itemX+itemY for itemX,itemY in zip(x,y)]

sum = []

for i in range(0,len(x)):
	for j in range(0,len(y)):
		sum.append(x[i]+y[j])

#Assign your output to the OUT variable.
OUT = sum
# ----------------------------------------
add_2 = code_block_5 + create  # lacing=CrossProduct
python_script_3 = Python(IN[0]=code_block_5, IN[1]=create)
# ---------- python_script_3.python (21 lines) ----------
import clr
clr.AddReference('ProtoGeometry')
from Autodesk.DesignScript.Geometry import *


x = IN[0]
y = IN[1]

#sum1 = x+y[0]

#sum2 = x+y[1]

#sum = [itemX+itemY for itemX,itemY in zip(x,y)]

sum = []

for i in range(0,len(x)):
	sum.append(x[i]+y[i])
		
#Assign your output to the OUT variable.
OUT = sum
# ----------------------------------------
add_3 = code_block_5 + create
code_block_6 = CodeBlock()
# ---------- code_block_6.designscript (13 lines) ----------
/*

# Zip Replication on Level 1 for <1L> of xs, <1L> of ys, <1L> of zs
for x, y, z in xs, ys, zs
    # Zip Replication on level 2 for <2> of xs, <2> of zs
    for each ix, iz in x, z
        # Cartesian Replication on level 2 for <3> of ys
        for each iy in y
            # Cartesian Replication on level 3 for <2> of zs
            for each iiz in iz
                foo(ix, iy, iiz);

*/;
# ----------------------------------------
code_block_7 = CodeBlock { {{1,2},{3,4}}; }
code_block_8 = CodeBlock { {5,6}; }
byCoordinates = Point.ByCoordinates(x=code_block_7, y=code_block_8)
code_block_9 = CodeBlock { {{1,2},{3,4}}; }
code_block_10 = CodeBlock { {{5,6},{7,8}}; }
byCoordinates_2 = Point.ByCoordinates(x=code_block_9, y=code_block_10)
python_script_4 = Python(IN[0]=code_block_7, IN[1]=code_block_8)
# ---------- python_script_4.python (19 lines) ----------
import clr
clr.AddReference('ProtoGeometry')
from Autodesk.DesignScript.Geometry import *
#The inputs to this node will be stored as a list in the IN variables.
xs1 = IN[0]
ys1 = IN[1]

replication = []

cartesian = []

for x,y in zip(xs1,ys1):
	replication.append([x,y])
	for item in x:
		cartesian.append([item, y])


#Assign your output to the OUT variable.
OUT = cartesian
# ----------------------------------------
python_script_5 = Python(IN[0]=code_block_9, IN[1]=code_block_10)
# ---------- python_script_5.python (21 lines) ----------
import clr
clr.AddReference('ProtoGeometry')
from Autodesk.DesignScript.Geometry import *
#The inputs to this node will be stored as a list in the IN variables.
xs1 = IN[0]
ys1 = IN[1]

replication = []

cartesian = []

for x,y in zip(xs1,ys1):
	replication.append([x,y])
	subList = []
	cartesian.append(subList)
	for itemX, itemY in zip(x,y):
		subList.append([itemX, itemY])


#Assign your output to the OUT variable.
OUT = cartesian
# ----------------------------------------
code_block_11 = CodeBlock { {{1,2},{3,4}}; }
code_block_12 = CodeBlock { {{5,6},{7,8}}; }
byCoordinates_3 = Point.ByCoordinates(x=code_block_11@L1, y=code_block_12)
python_script_6 = Python(IN[0]=code_block_11, IN[1]=code_block_12)
# ---------- python_script_6.python (21 lines) ----------
import clr
clr.AddReference('ProtoGeometry')
from Autodesk.DesignScript.Geometry import *
#The inputs to this node will be stored as a list in the IN variables.
xs = IN[0]
ys = IN[1]

replication = []

cartesian = []

for i in range(0,len(xs)):
	subList = []
	cartesian.append(subList)
	for j in range(0,len(xs[i])):
		for y in ys:
			subList.append([xs[i][j],y])


#Assign your output to the OUT variable.
OUT = cartesian
# ----------------------------------------
python_script_7 = Python(IN[0]=code_block_11, IN[1]=code_block_12)
# ---------- python_script_7.python (22 lines) ----------
import clr
clr.AddReference('ProtoGeometry')
from Autodesk.DesignScript.Geometry import *
#The inputs to this node will be stored as a list in the IN variables.
xs = IN[0]
ys = IN[1]

replication = []

cartesian = []

for itemX, itemY in xs,ys:
	subList = []
	cartesian.append(subList)
	for x,y in itemX,itemY:
		subSub = []
		subList.append(subSub)
		subSub.append([str(x)+"&"+str(y)])


#Assign your output to the OUT variable.
OUT = cartesian
# ----------------------------------------
python_script_8 = Python(IN[0]=code_block_11, IN[1]=code_block_12)
# ---------- python_script_8.python (24 lines) ----------
import clr
clr.AddReference('ProtoGeometry')
from Autodesk.DesignScript.Geometry import *
#The inputs to this node will be stored as a list in the IN variables.
xs = IN[0]
ys = IN[1]

replication = []

cartesian = []

for item in xs:
	subList = []
	cartesian.append(subList)
	for x in item:
		subSub = []
		subList.append(subSub)
		for item in ys:
			for y in item:
				subSub.append([str(x)+"&"+str(y)])


#Assign your output to the OUT variable.
OUT = cartesian
# ----------------------------------------
add_4 = code_block_7 + code_block_8
