# Dynamo graph readGSA.dyn (Dynamo 1.3.1.1736)

file_path = Filename("C:\Users\giovanni.brogiolo\Desktop\gs4.gwb")
openGsaFile = ReadGsa.Core.OpenGsaFile(file_path)
GSAList = ReadGsa.Core.GSAList(openGsaFile)
elementsOutputs = ReadGsa.GSAElements.ElementsOutputs()  # unwired: arg0, arg1
code_block = CodeBlock { "GET,PROP_SEC"; }
code_block_2 = CodeBlock { 1..10; }
gwaCommand = ReadGsa.Core.GwaCommand(openGsaFile, code_block, code_block_2)
code_block_3 = CodeBlock { "GET,EL"; }
openGsaFile_2 = ReadGsa.Core.OpenGsaFile(file_path)
code_block_4 = CodeBlock { 1..10; }
nodesFromRefs = ReadGsa.GSANodes.NodesFromRefs(openGsaFile, code_block_4)
code_block_5 = CodeBlock { "all"; }
elements = ReadGsa.GSAElements.Elements(openGsaFile, code_block_5)
code_block_6 = CodeBlock(a=elements.out1) { a-1; }
getItemAtIndex = List.GetItemAtIndex(list=nodesFromRefs.out1@L2, index=code_block_6, lacing=Longest)
deconstruct = List.Deconstruct(list=getItemAtIndex, lacing=Longest)
byStartPointEndPoint = Line.ByStartPointEndPoint(startPoint=deconstruct.first, endPoint=deconstruct.rest)
code_block_7 = CodeBlock { 0.5; }
pointAtParameter = Curve.PointAtParameter(curve=byStartPointEndPoint, param=code_block_7)
