# Dynamo graph rename files.dyn (Dynamo 2.0.0.3911)

string = StringInput("C:\Users\giovanni.brogiolo\Dropbox\QTO\2b4")
contents = Custom[Directory.ContentsAll](directoryPath=string)  # "Directory.Contents+"; Unlike the built-in node Directory.Contents, this node browses a directory recursively and returns all relevant files contained in subfolders as well.
code_block = CodeBlock { 1; }
fileName = FilePath.FileName(contents, code_block)
code_block_2 = CodeBlock { ".csv"; }
code_block_3 = CodeBlock { ".xls"; }
replace = String.Replace(str=fileName, searchFor=code_block_2, replaceWith=code_block_3, lacing=Longest)
code_block_4 = CodeBlock { 1; }
python_script = Python(IN[0]=string, IN[1]=fileName, IN[2]=replace, IN[3]=code_block_4)
# ---------- python_script.python (40 lines) ----------
# Copyright(c) 2016, Konrad Sobon
# @arch_laboratory, http://archi-lab.net

import sys
pyt_path = r'C:\Program Files (x86)\IronPython 2.7\Lib'
sys.path.append(pyt_path)

import os

filePath = IN[0]
identifiers = IN[1]
newNames = IN[2]
RunIt = IN[3]

files = os.listdir(filePath)

if RunIt:
	try:
		errorReport = None
		for file in files:
			currentFileName = filePath + "\\" + file
		
			for i, j in zip(identifiers, newNames):
				newFileName = filePath + "\\" + j
	
				if i in file and currentFileName != newFileName:
					os.rename(currentFileName, newFileName)
	except:
		# if error accurs anywhere in the process catch it
		import traceback
		errorReport = traceback.format_exc()
else:
	errorReport = "Set RunMe to True."

#Assign your output to the OUT variable
if errorReport == None:
	OUT = newNames
else:
	OUT = errorReport,files
	
# ----------------------------------------
string_2 = StringInput("C:\Users\giovanni.brogiolo\Dropbox\QTO\1b1")
code_block_5 = CodeBlock { ".txt"; }
