# Dynamo graph renameBeamsByGridlines.dyn (Dynamo 1.3.2.2480)

categories = Categories("StructuralFraming")
all_elements_of_category = ElementsOfCategory(categories)
categories_2 = Categories("Grids")
all_elements_of_category_2 = ElementsOfCategory(categories_2)
location = StructuralFraming.Location(all_elements_of_category)

# group: Get beam center point
code_block = CodeBlock { 0.5; }
pointAtParameter = Curve.PointAtParameter(curve=location, param=code_block)

curve = Grid.Curve(all_elements_of_category_2)
distanceTo = Geometry.DistanceTo(geometry=pointAtParameter, other=curve, lacing=CrossProduct)

# group: find the 3 closest grids
sort = List.Sort(distanceTo)
code_block_2 = CodeBlock { 3; }
takeItems = List.TakeItems(list=sort, amount=code_block_2, lacing=Longest)

# group: get the grids
allIndicesOf = List.AllIndicesOf(list=distanceTo, item=takeItems, lacing=Longest)
getItemAtIndex = List.GetItemAtIndex(list=all_elements_of_category_2, index=allIndicesOf)

# group: extract the grids name
name = Element.Name(getItemAtIndex)
flatten = Flatten(name@L3)
python_script = Python(IN[0]=flatten)
# ---------- python_script.python (2 lines) ----------
#Assign your output to the OUT variable.
OUT = [c[0]+c[1]+c[2] for c in IN[0]]
# ----------------------------------------

# group: Write value to the beam
code_block_3 = CodeBlock { "Comments"; }
setParameterByName = Element.SetParameterByName(element=all_elements_of_category, parameterName=code_block_3, value=python_script)
