# Dynamo graph renameGrids.dyn (Dynamo 0.8.2.2392)

select_model_elements = DSModelElementsSelection()
reverse = List.Reverse(select_model_elements)
code_block = CodeBlock { "Name"; }
code_block_2 = CodeBlock { 7..17; }
code_block_3 = CodeBlock { 1; }
fromNumber = Custom[Character.FromNumber](n=code_block_2, upperCase=code_block_3)  # Converts a number into a character (where 1 = A, 2 = B, ... , 27 = AA, 28 = AB etc.).
reverse_2 = List.Reverse(fromNumber)
setParameterByName = Element.SetParameterByName(element=reverse, parameterName=code_block, value=reverse_2)
getParameterValueByName = Element.GetParameterValueByName(element=reverse, parameterName=code_block)
code_block_4 = CodeBlock { 4..24; }
string_from_object = FromObject(code_block_4)
code_block_5 = CodeBlock { 2; }
code_block_6 = CodeBlock { "0"; }
padLeft = String.PadLeft(string_from_object, code_block_5, code_block_6)
reverse_3 = List.Reverse(padLeft)
