# Dynamo graph replaceColumns.dyn (Dynamo 1.3.1.1736)

structural_column_types = StructuralColumnTypes("UKC305x305x118")
select_model_elements = DSModelElementsSelection()  # 11 picked in the model
location = Custom[Element.Location](element=select_model_elements)  # Returns the location of an element as an XYZ (or if it's line-based the start and end point of the line), along with some booleans to help filtering the results. Use this for some element types (e.g. walls or lines) that do not work with the built-in Get Family Instance Location node.
code_block = CodeBlock { "Base Level"; }
getParameterValueByName = Element.GetParameterValueByName(element=select_model_elements, parameterName=code_block)
byPointAndLevel = FamilyInstance.ByPointAndLevel(familyType=structural_column_types, point=location.points, level=getParameterValueByName)
code_block_2 = CodeBlock { {"Top Level","Top Offset", "Mark"}; }
getParameterValueByName_2 = Element.GetParameterValueByName(element=select_model_elements, parameterName=code_block_2, lacing=CrossProduct)
transpose = List.Transpose(getParameterValueByName_2)
setParameterByName = Element.SetParameterByName(element=byPointAndLevel@L2, parameterName=code_block_2@L1, value=transpose, lacing=Longest)
