# Dynamo graph revCloudDrawing.dyn (Dynamo 1.3.3.4651)

categories = Categories("RevisionClouds")
all_elements_of_category = ElementsOfCategory(categories)
code_block = CodeBlock { "Revision"; }
getParameterValueByName = Element.GetParameterValueByName(parameterName=code_block)  # unwired: element
groupByFunction = GroupByFunction(all_elements_of_category, getParameterValueByName)
code_block_2 = CodeBlock { "Revision"; }
getParameterValueByName_2 = Element.GetParameterValueByName(element=groupByFunction, parameterName=code_block_2)
name = Element.Name(getParameterValueByName_2)
ownerView = Custom[Element.OwnerView](element=groupByFunction, lacing=Longest)  # Gets the owner view of a given Revit element (if possible)
sheetNumber = Sheet.SheetNumber(ownerView)
code_block_3 = CodeBlock { "Sheet Number"; }
getParameterValueByName_3 = Element.GetParameterValueByName(element=ownerView, parameterName=code_block_3)
