# Dynamo graph rhynamo.dyn (Dynamo 2.0.2.6826)

rhino_BrepsToDS = Interoperability.ReadRhino.RhinoTranslationToDS.Rhino_BrepsToDS()  # unwired: RhinoObjects
file_path = Filename("C:\Users\giovanni.brogiolo\Desktop\Tunnels.3dm")
get_RhinoFile = Interoperability.ReadRhino.OpenRhino3dmModel.Get_RhinoFile(RhinoFile=file_path)
get_RhinoObjects = Interoperability.ReadRhino.RhinoObject.Get_RhinoObjects(RhinoModel=get_RhinoFile.RhinoModel)
rhino_ExtrusionToDS = Interoperability.ReadRhino.RhinoTranslationToDS.Rhino_ExtrusionToDS(RhinoObjects=get_RhinoObjects)
