# Dynamo graph roomSetCenterLocation.dyn (Dynamo 1.3.3.4651)

# note: Copyright(c) 2018, Parametric Monkey
# https://parametricmonkey.com/
# Licence: CC BY-SA 4.0
# https://creativecommons.org/licenses/by-sa/4.0/
# Dependencies:
# - Based on the script by Modelical

boolean = BoolSelector(false)

# group: From Parametric Monkey
getAll = Custom[Room.GetAll](update=boolean)  # Collects placed rooms from the Revit document

isNull = Object.IsNull(getAll.boundaryPolycurve)
# note: Valid rooms
filterByBoolMask = List.FilterByBoolMask(list=getAll.element, mask=isNull)
# note: Valid boundary polycurve
filterByBoolMask_2 = List.FilterByBoolMask(list=getAll.boundaryPolycurve, mask=isNull)

# group: Gets centroid
extrudeAsSolid = Curve.ExtrudeAsSolid(filterByBoolMask_2.out)
centroid = Solid.Centroid(extrudeAsSolid)
startPoint = Curve.StartPoint(filterByBoolMask_2.out)
code_block = CodeBlock(p1=centroid, p2=startPoint) { centroid = Autodesk.Point.ByCoordinates(p1.X, p1.Y, p2.Z); }

# group: Containment
explode = Geometry.Explode(filterByBoolMask_2.out)
startPoint_2 = Curve.StartPoint(explode)
byPoints = Polygon.ByPoints(startPoint_2)
containmentTest = Polygon.ContainmentTest(byPoints, code_block)

# group: Rooms
filterByBoolMask_3 = List.FilterByBoolMask(list=filterByBoolMask.out, mask=containmentTest)
flatten = Flatten(filterByBoolMask_3.in)

# note: Current position
location = DummyNode(flatten, inputCount=1, outputCount=1, legacyNodeName=Room.Location, legacyAssembly=RevitNodes.dll, nodeNature=Unresolved)  # "Room.Location"

# group: Centroid
filterByBoolMask_4 = List.FilterByBoolMask(list=code_block, mask=containmentTest)
# note: New position
flatten_2 = Flatten(filterByBoolMask_4.in)

# group: To Revit
byTwoPoints = Vector.ByTwoPoints(start=location, end=flatten_2)
moveByVector = DummyNode(flatten, inputCount=1, outputCount=1, legacyNodeName=Element.MoveByVector, legacyAssembly=RevitNodes.dll, nodeNature=Unresolved)  # "Element.MoveByVector"

# group: Output
code_block_2 = CodeBlock(roomsMoved=flatten) { roomsMoved; }
code_block_3 = CodeBlock(roomsNotMoved=filterByBoolMask_3.out) { roomsNotMoved; }
code_block_4 = CodeBlock(invalidRooms=filterByBoolMask.in) { invalidRooms; }

centreLocation = Custom[Room.CentreLocation]()  # Moves room to the centroid of the room. If the centroid is outside of the room boundary, the room will remain in its current position. Tutorial: https://parametricmonkey.com/2016/01/21/room-centre-location/; unwired: updateRooms
