# Dynamo graph scope box to workset.dyn (Dynamo 1.3.2.2480)

categories = Categories("VolumeOfInterest")
all_elements_of_category = ElementsOfCategory(categories)

# group: what are you trying to do here? Isn't the flatten output equal to all elements of category?
name = Element.Name(all_elements_of_category)
eq = name == name  # lacing=Longest
filterByBoolMask = List.FilterByBoolMask(list=all_elements_of_category, mask=eq)
flatten = Flatten(filterByBoolMask.in)

categories_2 = Categories("Walls")
all_elements_of_category_2 = ElementsOfCategory(categories_2)
boundingBox = Geometry.BoundingBox(all_elements_of_category)

# group: Option 1 - Repeat the list of walls
count = List.Count(boundingBox)
ofRepeatedItem = List.OfRepeatedItem(item=all_elements_of_category_2, amount=count)

boundingBox_2 = Geometry.BoundingBox(all_elements_of_category_2)
maxPoint = BoundingBox.MaxPoint(boundingBox_2)
create = List.Create(maxPoint)
flatten_2 = Flatten(create, lacing=Longest)
contains = BoundingBox.Contains(boundingBox, flatten_2, lacing=Longest)
filterByBoolMask_2 = List.FilterByBoolMask(list=ofRepeatedItem, mask=contains)
code_block = CodeBlock(a=filterByBoolMask_2.in) { a; }
isEmpty = List.IsEmpty(code_block, lacing=Longest)
filterByBoolMask_3 = List.FilterByBoolMask(list=code_block, mask=isEmpty)
code_block_2 = CodeBlock { "Workset"; }
byName = WombatDynamo.Workset.ByName(name)
id = WombatDynamo.Workset.Id(byName)
filterByBoolMask_4 = List.FilterByBoolMask(list=id, mask=isEmpty)
setParameterByName = Element.SetParameterByName(element=filterByBoolMask_3.out, parameterName=code_block_2, value=filterByBoolMask_4.out)
byName_2 = Archilab.Grimshaw.Elements.Workset.ByName()  # unwired: arg0
id_2 = Archilab.Grimshaw.Elements.Workset.Id(byName_2)
minPoint = BoundingBox.MinPoint(boundingBox_2)

# group: Option 2 - List at level and lacing
filterByBoolMask_5 = List.FilterByBoolMask(list=all_elements_of_category_2@L2, mask=contains, lacing=Longest)

# group: Wrong output
filterByBoolMask_6 = List.FilterByBoolMask(list=all_elements_of_category_2, mask=contains, lacing=Longest)

# note: Elements inside a workset
getElementsIntersect = Revit.BoundingBox.GetElementsIntersect(boundingBox, all_elements_of_category_2)
flatten_3 = Flatten(getElementsIntersect)
# note: Elements not inside a workset
setDifference = SetDifference(all_elements_of_category_2, flatten_3)
