# Dynamo graph selectBeamsOnly.dyn (Dynamo 2.0.1.5055)

refresh = BoolSelector(false)

# group: Select beams
python_script = Python(IN[0]=refresh)
# ---------- python_script.python (52 lines) ----------
import clr

clr.AddReference('RevitAPI')
from Autodesk.Revit.DB import *
from Autodesk.Revit.DB.Structure import *


clr.AddReference('RevitAPIUI')
from Autodesk.Revit.UI import *
from Autodesk.Revit.UI.Selection import *


clr.AddReference('System')
from System.Collections.Generic import List

clr.AddReference('RevitNodes')
import Revit
clr.ImportExtensions(Revit.GeometryConversion)
clr.ImportExtensions(Revit.Elements)

clr.AddReference('RevitServices')
import RevitServices
from RevitServices.Persistence import DocumentManager
from RevitServices.Transactions import TransactionManager

import math
from System.Collections.Generic import Dictionary,List

doc = DocumentManager.Instance.CurrentDBDocument
uidoc=DocumentManager.Instance.CurrentUIApplication.ActiveUIDocument


class CustomISelectionFilter(ISelectionFilter):
	def __init__(self, category_name):
		self.category_name = category_name
	def AllowElement(self, e):
		if e.Category.Name == self.category_name:
			return True
		else:
			return False
	def AllowReference(self, ref, point):
		return false
		

try:
    beam = uidoc.Selection.PickObjects(ObjectType.Element, CustomISelectionFilter("Structural Framing"), "Select a Beam")
    TaskDialog.Show("Result", "You have selected " + str(len(beam)) + " beams")
except:
    TaskDialog.Show("Operation Cancelled","The user cancelled the operation")
    
    
OUT = [doc.GetElement(b) for b in beam]
# ----------------------------------------
