# Dynamo graph selectTagsByLine.dyn (Dynamo 2.0.1.5055)

# group: Press Run. To Run again, set refresh to True or False
refresh = BoolSelector(true)
python_script = Python(IN[0]=refresh)
# ---------- python_script.python (61 lines) ----------
import clr

clr.AddReference('RevitAPI')
from Autodesk.Revit.DB import *
from Autodesk.Revit.DB.Structure import *


clr.AddReference('RevitAPIUI')
from Autodesk.Revit.UI import *
from Autodesk.Revit.UI.Selection import *


clr.AddReference('System')
from System.Collections.Generic import List

clr.AddReference('RevitNodes')
import Revit
clr.ImportExtensions(Revit.GeometryConversion)
clr.ImportExtensions(Revit.Elements)

clr.AddReference('RevitServices')
import RevitServices
from RevitServices.Persistence import DocumentManager
from RevitServices.Transactions import TransactionManager

import math
from System.Collections.Generic import Dictionary,List

doc = DocumentManager.Instance.CurrentDBDocument
uidoc=DocumentManager.Instance.CurrentUIApplication.ActiveUIDocument


class CustomISelectionFilter(ISelectionFilter):
	def __init__(self):
		pass
	def AllowElement(self, e):
		if e.Category.Name == "Structural Framing":
			return True
		elif e.Category.Name == "Structural Framing Tags":
			return True
		else:
			return False
	def AllowReference(self, ref, point):
		return False
		
beams = []
curves = []
tags = []

try:
    beam = uidoc.Selection.PickObjects(ObjectType.Element, CustomISelectionFilter(), "Select some objects")
    element = [doc.GetElement(b) for b in beam]
    [beams.append(e) for e in element if e.Category.Name == "Structural Framing" ]
    [curves.append(e.Location.Curve.ToProtoType()) for e in element if e.Category.Name == "Structural Framing" ]
    [tags.append(e) for e in element if e.Category.Name == "Structural Framing Tags" ]
except:
    TaskDialog.Show("Operation Cancelled","The user cancelled the operation")


    
OUT = beams, curves, tags
# ----------------------------------------

code_block = CodeBlock(tags=python_script) { tags[2]; }
code_block_2 = CodeBlock(beams=python_script) { beams[0]; }
code_block_3 = CodeBlock(curves=python_script) { curves[1]; }
XY = Plane.XY()
pullOntoPlane = Curve.PullOntoPlane(curve=code_block_3, plane=XY)

# group: Select a line crossing the beams. The script will select their tags
select_model_element = DSModelElementSelection()  # 1 picked in the model

python_script_2 = Python(IN[0]=select_model_element)
# ---------- python_script_2.python (37 lines) ----------
import clr

clr.AddReference('RevitAPI')
from Autodesk.Revit.DB import *
from Autodesk.Revit.DB.Structure import *


clr.AddReference('RevitAPIUI')
from Autodesk.Revit.UI import *
from Autodesk.Revit.UI.Selection import *


clr.AddReference('System')
from System.Collections.Generic import List

clr.AddReference('RevitNodes')
import Revit
clr.ImportExtensions(Revit.GeometryConversion)
clr.ImportExtensions(Revit.Elements)

clr.AddReference('RevitServices')
import RevitServices
from RevitServices.Persistence import DocumentManager
from RevitServices.Transactions import TransactionManager

import math
from System.Collections.Generic import Dictionary,List

doc = DocumentManager.Instance.CurrentDBDocument
uidoc=DocumentManager.Instance.CurrentUIApplication.ActiveUIDocument


		
grid = UnwrapElement(IN[0])

    
OUT = doc.GetElement(grid.GetGridIds()[0]).Curve.ToProtoType()
# ----------------------------------------
pullOntoPlane_2 = Curve.PullOntoPlane(curve=python_script_2, plane=XY)
doesIntersect = Geometry.DoesIntersect(geometry=pullOntoPlane, other=pullOntoPlane_2, lacing=Longest)
filterByBoolMask = List.FilterByBoolMask(list=code_block_2, mask=doesIntersect)
python_script_3 = Python(IN[0]=code_block, IN[1]=filterByBoolMask.in)
# ---------- python_script_3.python (50 lines) ----------
import clr

clr.AddReference('RevitAPI')
from Autodesk.Revit.DB import *
from Autodesk.Revit.DB.Structure import *


clr.AddReference('RevitAPIUI')
from Autodesk.Revit.UI import *
from Autodesk.Revit.UI.Selection import *


clr.AddReference('System')
from System.Collections.Generic import List

clr.AddReference('RevitNodes')
import Revit
clr.ImportExtensions(Revit.GeometryConversion)
clr.ImportExtensions(Revit.Elements)

clr.AddReference('RevitServices')
import RevitServices
from RevitServices.Persistence import DocumentManager
from RevitServices.Transactions import TransactionManager

import math
from System.Collections.Generic import Dictionary,List

doc = DocumentManager.Instance.CurrentDBDocument
uidoc=DocumentManager.Instance.CurrentUIApplication.ActiveUIDocument


tag = UnwrapElement(IN[0])

beams = UnwrapElement(IN[1])

ids = [b.Id for b in beams]

getLocalElementId = [t.GetTaggedLocalElement().Id for t in tag]


selected = []

for g in getLocalElementId:
	if g in ids:
		selected.append(True)
	else:
		selected.append(False)

OUT = ids, getLocalElementId, selected
# ----------------------------------------
code_block_4 = CodeBlock(a=python_script_3) { a[2]; }
filterByBoolMask_2 = List.FilterByBoolMask(list=code_block, mask=code_block_4)
python_script_4 = Python(IN[0]=filterByBoolMask_2.in)
# ---------- python_script_4.python (49 lines) ----------
import clr

clr.AddReference('RevitAPI')
from Autodesk.Revit.DB import *
from Autodesk.Revit.DB.Structure import *


clr.AddReference('RevitAPIUI')
from Autodesk.Revit.UI import *
from Autodesk.Revit.UI.Selection import *


clr.AddReference('System')
from System.Collections.Generic import List

clr.AddReference('RevitNodes')
import Revit
clr.ImportExtensions(Revit.GeometryConversion)
clr.ImportExtensions(Revit.Elements)

clr.AddReference('RevitServices')
import RevitServices
from RevitServices.Persistence import DocumentManager
from RevitServices.Transactions import TransactionManager

import math
from System.Collections.Generic import Dictionary,List

doc = DocumentManager.Instance.CurrentDBDocument
uidoc=DocumentManager.Instance.CurrentUIApplication.ActiveUIDocument


elements = UnwrapElement(IN[0])


highlight = []
elements = UnwrapElement(IN[0])
elementsel = uidoc.Selection
result = []

for i in elements:
	highlight.append(i.Id)
	Icollection = List[ElementId](highlight)
	elementsel.SetElementIds(Icollection)
	result.append("Success")
	
	
	
OUT = result
# ----------------------------------------
curves = Element.Curves(element=select_model_element)
