# Dynamo graph setDrapeValue.dyn (Dynamo 1.3.2.2480)

# group: select all the drape annotations
family_types = FamilyTypes("Arup_PT_Drape Annotation:Drape Height")
all_elements_of_family_type = ElementsOfFamilyType(family_types)

# group: divide High and Low
code_block = CodeBlock { "Cross Visible"; }
getParameterValueByName = Element.GetParameterValueByName(parameterName=code_block)  # unwired: element
groupByFunction = GroupByFunction(all_elements_of_family_type, getParameterValueByName)

# group: separate High and Low elements
deconstruct = List.Deconstruct(list=groupByFunction)

code_block_2 = CodeBlock { "Drape"; }

# group: extract Z coordinate for Low elements
code_block_3 = CodeBlock { "Drape"; }
getParameterValueByName_2 = Element.GetParameterValueByName(element=deconstruct.first, parameterName=code_block_3)

toNumber = String.ToNumber(getParameterValueByName_2)

# group: subtract 12 to the Low and write value to Revit
code_block_4 = CodeBlock { -12; }
sub = toNumber - code_block_4

# group: round to nearest 5
python_script = Python(IN[0]=sub)
# ---------- python_script.python (5 lines) ----------
def myround(x, base=5):
    return int(base * round(float(x)/base))
    
    
OUT = [myround(item) for item in IN[0]]
# ----------------------------------------

string_from_object = FromObject(python_script)

# group (continued): subtract 12 to the Low and write value to Revit
setParameterByName = Element.SetParameterByName(element=deconstruct.first, parameterName=code_block_2, value=string_from_object)

flatten = Flatten(deconstruct.rest)

# group: extract Z coordinate for High elements
code_block_5 = CodeBlock { "Drape"; }
getParameterValueByName_3 = Element.GetParameterValueByName(element=flatten, parameterName=code_block_5)

toNumber_2 = String.ToNumber(getParameterValueByName_3)

# group: subtract 7 to the High and write value to Revit
code_block_6 = CodeBlock { -7; }
add = toNumber_2 + code_block_6

# group: round to nearest 5
python_script_2 = Python(IN[0]=add)  # same code as python_script

string_from_object_2 = FromObject(python_script_2)

# group (continued): subtract 7 to the High and write value to Revit
setParameterByName_2 = Element.SetParameterByName(element=deconstruct.rest, parameterName=code_block_2, value=string_from_object_2)
