# Dynamo graph setElementId.dyn (Dynamo 1.3.2.2480)

select_model_element = DSModelElementSelection()  # 1 picked in the model
parameters = Element.Parameters(select_model_element)
code_block = CodeBlock(a=parameters) { a[4]; }
python_script = Python(IN[0]=code_block)
# ---------- python_script.python (38 lines) ----------
import clr
clr.AddReference("ProtoGeometry")
from Autodesk.DesignScript.Geometry import *

# Import RevitAPI
clr.AddReference("RevitAPI")
from Autodesk.Revit.DB import *
from Autodesk.Revit.DB import Parameter

clr.AddReference("RevitAPIUI")
from Autodesk.Revit.UI import TaskDialog
# Import DocumentManager and TransactionManager
clr.AddReference("RevitServices")
from RevitServices.Persistence import DocumentManager
from RevitServices.Transactions import TransactionManager
# Import ToProtoType, ToRevitType geometry conversion extension methods
clr.AddReference("RevitNodes")
import Revit
clr.ImportExtensions(Revit.GeometryConversion)

import math

doc = DocumentManager.Instance.CurrentDBDocument
uiapp = DocumentManager.Instance.CurrentUIApplication
app = uiapp.Application


ele = UnwrapElement(IN[0])

newId = ElementId(1234567)

TransactionManager.Instance.EnsureInTransaction(doc)

#ele.Set(ElementId(newId));

TransactionManager.Instance.TransactionTaskDone()

OUT = ele.Value
# ----------------------------------------
bv_ids_to_elements = Custom[bv IDs to Elements]()  # forked from CAAD_RWTH; unwired: IDs
duct_clash_check = Custom[Duct Clash Check]()  # Check Clash; unwired: Beams, Ducts
id = Parameter.Id(parameters)
