# Dynamo graph setLocation.dyn (Dynamo 2.0.1.5055)

select_model_element = DSModelElementSelection()  # nothing selected; graph input
python_script = Python(IN[0]=select_model_element)
# ---------- python_script.python (42 lines) ----------
import clr
# Import RevitAPI
clr.AddReference("RevitAPI")
import Autodesk
from Autodesk.Revit.DB import *
# Import DocumentManager and TransactionManager
clr.AddReference("RevitServices")
import RevitServices
from RevitServices.Persistence import DocumentManager
from RevitServices.Transactions import TransactionManager
# Import ToDSType(bool) extension method
clr.AddReference("RevitNodes")
import Revit
clr.ImportExtensions(Revit.Elements)
clr.ImportExtensions(Revit.GeometryConversion)

def GetEndPoints(line):
	return [Curve.GetEndPoint(0).ToPoint(), 
		Curve.GetEndPoint(1).ToPoint()]
		
# Unwrap
beam = UnwrapElement( IN[0] )
#lines = UnwrapElement( IN[1] )

# Start Transaction
doc = DocumentManager.Instance.CurrentDBDocument

TransactionManager.Instance.EnsureInTransaction(doc)

try:
	newBeamId = ElementTransformUtils.CopyElement(doc, beam.Id, XYZ(0,0,0))
	newBeam = doc.GetElement(newBeamId[0])
	#newBeam.Location.Curve = lines[1].ToRevitType()
	
	#beam.Location.Curve	= lines[0].ToRevitType()
	
	OUT = beam, newBeam
except:
	OUT = "error"
# End Transaction
TransactionManager.Instance.TransactionTaskDone()
# Wrap
# ----------------------------------------
location = StructuralFraming.Location(structuralFraming=select_model_element)
startPoint = Curve.StartPoint(curve=location)

# group: PB beam
select_model_element_2 = DSModelElementSelection()  # nothing selected; graph input

location_2 = StructuralFraming.Location(structuralFraming=select_model_element_2)
intersectAll = Geometry.IntersectAll(geometry=location_2, others=location)
byStartPointEndPoint = Line.ByStartPointEndPoint(startPoint=startPoint, endPoint=intersectAll)
endPoint = Curve.EndPoint(curve=location)
byStartPointEndPoint_2 = Line.ByStartPointEndPoint(startPoint=intersectAll, endPoint=endPoint)
code_block = CodeBlock(a=byStartPointEndPoint, b=byStartPointEndPoint_2) { [a,b]; }
setLocation = Element.SetLocation(element=python_script, geometry=code_block, lacing=Longest)
