# Dynamo graph setPileOffst.dyn (Dynamo 2.0.1.4955)

Z = Point.Z()  # unwired: point
select_model_elements = DSModelElementsSelection()  # 4 picked in the model
code_block = CodeBlock { "Height Offset From Level"; }
setParameterByName = Element.SetParameterByName(element=select_model_elements, parameterName=code_block)  # unwired: value
toCuboid = BoundingBox.ToCuboid()  # unwired: boundingBox
curves = Element.Curves(element=select_model_elements)
endPoint = Curve.EndPoint(curve=curves@L1)
startPoint = Curve.StartPoint(curve=curves@L1)
list_create = List.Create(item0=endPoint, item1=startPoint)
ZAxis = Vector.ZAxis()
code_block_2 = CodeBlock { 1; }
current = Document.Current()
activeView = Document.ActiveView(document=current)
byOriginDirection = Revit.References.RayBounce.ByOriginDirection(origin=list_create, direction=ZAxis, maxBounces=code_block_2, view=activeView)
code_block_3 = CodeBlock(aaa=byOriginDirection.points) { aaa; }
code_block_4 = CodeBlock { 1; }
getItemAtIndex = List.GetItemAtIndex(list=code_block_3@@L2, index=code_block_4, lacing=Longest)
deconstruct = List.Deconstruct(list=getItemAtIndex)
code_block_5 = CodeBlock(a=deconstruct.first) { a; }
code_block_6 = CodeBlock(a=deconstruct.rest) { a[0]; }
byStartPointEndPoint = Line.ByStartPointEndPoint(startPoint=code_block_5, endPoint=code_block_6)
byCurve = ModelCurve.ByCurve(curve=byStartPointEndPoint)
select_model_element = DSModelElementSelection()  # 1 picked in the model
select_face = DSFaceSelection()  # 1 picked in the model
perimeterCurves = Surface.PerimeterCurves(surface=select_face)
levels = Levels(index=0)
structural_framing_types = StructuralFramingTypes(index=0)
beamByCurve = StructuralFraming.BeamByCurve(curve=perimeterCurves, level=levels, structuralFramingType=structural_framing_types)
code_block_7 = CodeBlock(a=beamByCurve) { a[0]; }
location = StructuralFraming.Location(structuralFraming=beamByCurve@L1)
direction = Line.Direction(line=location)
X = Vector.X(vector=direction)
Y = Vector.Y(vector=direction)
sub = X - Y
code_block_8 = CodeBlock { 0; }
eq = sub == code_block_8
filterByBoolMask = List.FilterByBoolMask(list=code_block_7, mask=eq)
aqua = Custom[Color.Aqua]()  # Returns the colour aqua.
overrideColorInView = Element.OverrideColorInView(element=filterByBoolMask.in, color=aqua)
string = StringInput("Cross-Section Rotation")
code_block_9 = CodeBlock { 90; }
setParameterByName_2 = Element.SetParameterByName(element=overrideColorInView, parameterName=string, value=code_block_9)
deconstruct_2 = WombatDynamo.Vector.Deconstruct()  # unwired: vector
code_block_10 = CodeBlock(a=X) { a-b; }  # unwired: b
join = List.Join(list0=X, list1=Y)
list_create_2 = List.Create(item0=X, item1=Y)
byPoints = PolyCurve.ByPoints()  # unwired: points
ofRepeatedItem = List.OfRepeatedItem()  # unwired: item, amount
firstItem = List.FirstItem()  # unwired: list
lastItem = List.LastItem()  # unwired: list
maximumItem = List.MaximumItem()  # unwired: list
minimumItem = List.MinimumItem()  # unwired: list
map = List.Map()  # unwired: list, f_x
clean = List.Clean()  # unwired: list
restOfItems = List.RestOfItems()  # unwired: list
flatten = List.Flatten(list=code_block_3)
code_block_11 = CodeBlock { 2; }
chop = List.Chop(list=flatten, lengths=code_block_11)
transpose = List.Transpose(lists=chop)
select_model_elements_2 = DSModelElementsSelection()  # 26 picked in the model
type = archilab.Revit.Elements.Elements.Type(element=select_model_elements_2)
uniqueItems = List.UniqueItems(list=type)
allIndicesOf = List.AllIndicesOf(list=type, item=uniqueItems)
getItemAtIndex_2 = List.GetItemAtIndex(list=select_model_elements_2, index=allIndicesOf)
type_2 = archilab.Revit.Elements.Elements.Type()  # unwired: element
groupByFunction = List.GroupByFunction(list=select_model_elements_2, func=type_2)
