# Dynamo graph setPileOffst01.dyn (Dynamo 2.0.1.4955)

select_model_elements = DSModelElementsSelection()  # 12 picked in the model
code_block = CodeBlock { "Height Offset From Level"; }
boundingBox = Element.BoundingBox(element=select_model_elements)
maxPoint = BoundingBox.MaxPoint(boundingBox=boundingBox)
Z = Point.Z(point=maxPoint)
ZAxis = Vector.ZAxis()
code_block_2 = CodeBlock { 1; }
current = Document.Current()
activeView = Document.ActiveView(document=current)
byOriginDirection = Revit.References.RayBounce.ByOriginDirection(origin=maxPoint, direction=ZAxis, maxBounces=code_block_2, view=activeView)
code_block_3 = CodeBlock { 1; }
getItemAtIndex = List.GetItemAtIndex(list=byOriginDirection.points@L2, index=code_block_3, lacing=Longest)
Z_2 = Point.Z(point=getItemAtIndex)
code_block_4 = CodeBlock(a=Z, b=Z_2) { -(a-b); }
setParameterByName = Element.SetParameterByName(element=select_model_elements, parameterName=code_block, value=code_block_4)
