# Dynamo graph setRoomCenterPoint.dyn (Dynamo 2.0.1.5055)

# note: Copyright(c) 2018, Parametric Monkey
# https://parametricmonkey.com/
# Licence: CC BY-SA 4.0
# https://creativecommons.org/licenses/by-sa/4.0/
# Dependencies:
# - Based on the script by Modelical

# group: Collects rooms & data
categories = Categories(index=425)  # graph input
all_elements_of_category = ElementsOfCategory(Category=categories)

# note: Filter by placed rooms
area = Room.Area(room=all_elements_of_category)
code_block = CodeBlock { 0; }
gt = area > code_block
filterByBoolMask = List.FilterByBoolMask(list=all_elements_of_category, mask=gt)

# group (continued): Collects rooms & data
finishBoundary = Room.FinishBoundary(room=filterByBoolMask.in)
byJoinedCurves = PolyCurve.ByJoinedCurves(curves=finishBoundary)

firstItem = List.FirstItem(list=byJoinedCurves@L2)
flatten = List.Flatten(list=firstItem)

# group: Ouput
code_block_2 = CodeBlock(element=filterByBoolMask.in) { element; }
code_block_3 = CodeBlock(boundaryPolycurve=flatten) { boundaryPolycurve; }

isNull = Object.IsNull(obj=code_block_3)
# note: Valid rooms
filterByBoolMask_2 = List.FilterByBoolMask(list=code_block_2, mask=isNull)
# note: Valid boundary polycurve
filterByBoolMask_3 = List.FilterByBoolMask(list=code_block_3, mask=isNull)

# group: Gets centroid
extrudeAsSolid = Curve.ExtrudeAsSolid(curve=filterByBoolMask_3.out)
centroid = Solid.Centroid(solid=extrudeAsSolid)
startPoint = Curve.StartPoint(curve=filterByBoolMask_3.out)
code_block_4 = CodeBlock(p1=centroid, p2=startPoint) { centroid = Autodesk.Point.ByCoordinates(p1.X, p1.Y, p2.Z); }

# group: Containment
explode = Geometry.Explode(geometry=filterByBoolMask_3.out)
startPoint_2 = Curve.StartPoint(curve=explode)
byPoints = Polygon.ByPoints(points=startPoint_2)
containmentTest = Polygon.ContainmentTest(polygon=byPoints, point=code_block_4)

# group: Rooms
filterByBoolMask_4 = List.FilterByBoolMask(list=filterByBoolMask_2.out, mask=containmentTest)
flatten_2 = List.Flatten(list=filterByBoolMask_4.in)

# group: Output
code_block_5 = CodeBlock(roomsMoved=flatten_2) { roomsMoved; }
code_block_6 = CodeBlock(roomsNotMoved=filterByBoolMask_4.out) { roomsNotMoved; }
code_block_7 = CodeBlock(invalidRooms=filterByBoolMask_2.in) { invalidRooms; }

# note: Current position
location = Room.Location(room=flatten_2)

# group: Centroid
filterByBoolMask_5 = List.FilterByBoolMask(list=code_block_4, mask=containmentTest)
# note: New position
flatten_3 = List.Flatten(list=filterByBoolMask_5.in)

# group: To Revit
byTwoPoints = Vector.ByTwoPoints(start=location, end=flatten_3)
moveByVector = Element.MoveByVector(element=flatten_2, vector=byTwoPoints)
