# Dynamo graph simpilfyPerimeter.dyn (Dynamo 2.0.2.6826)

# group: Select a floor
select_model_element = DSModelElementSelection()  # 1 picked in the model

geometry = Element.Geometry(element=select_model_element)

# group: Option 1 - Extract edge curves from Floor sketch lines
elementSketch = Custom[Springs.Collector.ElementSketch](element=select_model_element)  # Get the actual sketch lines of a sketch based element (floor, ceiling, modified wall, etc.) . You can optionally fetch the matching model curves, however this might prove comptationally heavy on larger data sets. Does not work with elements from linked files.
code_block = CodeBlock(a=elementSketch.curves) { a[0][0]; }
floor_types = FloorTypes(index=15)
levels = Levels(index=6)

# group: Easy way to close the polycurve (super approximate)
startPoint = Curve.StartPoint(curve=code_block)
code_block_2 = CodeBlock { 1; }
byPoints = PolyCurve.ByPoints(points=startPoint, connectLastToFirst=code_block_2)

# group (continued): Option 1 - Extract edge curves from Floor sketch lines
byOutlineTypeAndLevel = Floor.ByOutlineTypeAndLevel(outline=byPoints, floorType=floor_types, level=levels)  # frozen

python_script = Python(IN[0]=select_model_element)
# ---------- python_script.python (42 lines) ----------
import clr

clr.AddReference('RevitAPI')
from Autodesk.Revit.DB import *
from Autodesk.Revit.DB.Structure import *

clr.AddReference('RevitAPIUI')
from Autodesk.Revit.UI import *

clr.AddReference('System')
from System.Collections.Generic import List

clr.AddReference('RevitNodes')
import Revit
clr.ImportExtensions(Revit.GeometryConversion)
clr.ImportExtensions(Revit.Elements)

clr.AddReference('RevitServices')
import RevitServices
from RevitServices.Persistence import DocumentManager
from RevitServices.Transactions import TransactionManager

doc = DocumentManager.Instance.CurrentDBDocument
uidoc=DocumentManager.Instance.CurrentUIApplication.ActiveUIDocument

#Preparing input from dynamo to revit
slab = UnwrapElement(IN[0])

opt = Options()

solid = slab.get_Geometry(opt)

faces = [s.Faces for s in solid]

areas = [f.Area for f in faces[0]]

topSrf = faces[0][0].ToProtoType()

edges = faces[0][0].GetEdgesAsCurveLoops()[0]


OUT = [e.ToProtoType() for e in edges]
# ----------------------------------------

# group: Better way to approximate original slab profile (still not 100% correct. It would be better to recreate the arcs).
code_block_3 = CodeBlock { [0..1..#10]; }
pointAtParameter = Curve.PointAtParameter(curve=python_script, param=code_block_3, lacing=CrossProduct)
flatten = List.Flatten(list=pointAtParameter)
code_block_4 = CodeBlock { 0.5; }
pruneDuplicates = Point.PruneDuplicates(points=flatten, tolerance=code_block_4)
code_block_5 = CodeBlock { 1; }
byPoints_2 = PolyCurve.ByPoints(points=pruneDuplicates, connectLastToFirst=code_block_5)

levels_2 = Levels(index=9)
byOutlineTypeAndLevel_2 = Floor.ByOutlineTypeAndLevel(outline=byPoints_2, floorType=floor_types, level=levels_2)

# group: Use python to extract the floor surface. Dynamo Element.Geoemtry node does not work
python_script_2 = Python(IN[0]=select_model_element)
# ---------- python_script_2.python (40 lines) ----------
import clr

clr.AddReference('RevitAPI')
from Autodesk.Revit.DB import *
from Autodesk.Revit.DB.Structure import *

clr.AddReference('RevitAPIUI')
from Autodesk.Revit.UI import *

clr.AddReference('System')
from System.Collections.Generic import List

clr.AddReference('RevitNodes')
import Revit
clr.ImportExtensions(Revit.GeometryConversion)
clr.ImportExtensions(Revit.Elements)

clr.AddReference('RevitServices')
import RevitServices
from RevitServices.Persistence import DocumentManager
from RevitServices.Transactions import TransactionManager

doc = DocumentManager.Instance.CurrentDBDocument
uidoc=DocumentManager.Instance.CurrentUIApplication.ActiveUIDocument

#Preparing input from dynamo to revit
slab = UnwrapElement(IN[0])

opt = Options()

solid = slab.get_Geometry(opt)

faces = [s.Faces for s in solid]

areas = [f.Area for f in faces[0]]

topSrf = faces[0][0].ToProtoType()


OUT = topSrf
# ----------------------------------------

# group: Speckle does not support Polysurfaces yet
anonymous_stream = Sender(A=python_script_2, DocumentName="simpilfyPerimeter", mySender="dVBNS8NAEE1qm0T0LCIe8gPCJmlMW4VANXgovUhrxVvZJFO7ZLsb9qPiX/eiu7aHXnwwbwbm8ebDcR3H+TGw2eKyZ2i27KBuKZRcQBS+gZCEsyJFORonSYayfJQNo7DUVGkBBQOtBKZR+KIrSuo5fL3yFljBNKUD63t7YoeO9WNHSkqAqYERnK8kiOcdJtR/whJWggZLJQDvZk1/wSkEB+mscV23716d2h06VmQXt+GdGbr5IHyPGSOoEtzUlE+x0B2q+c7rm364VaqTD3G8BakIRvJgiT65aGWMO+L97ZUtqnKebd4ng2/zo38G2xP9PaYa1msn6B0f6fmGrvN6Mmo2KQY8Ho6Tuyyp7ps6H6UXvw==", RestApi="https://hestia.speckle.works/api", Email="giovanni.brogiolo@arup.com", Server="Speckle Hestia", StreamId="3RbCK3fX8")

# group: Speckle sender to GH (to fix the geometry there)
anonymous_stream_2 = Sender(A=code_block, DocumentName="simpilfyPerimeter", mySender="dVBNS8NAEE1qk0b0LCIe8gPKNiYmaYVAtXgIXsS2gqeySUa7ZLMb9qPiX/eiu7aHXnwwbwbm8ebDcR3H+TGw2eJ8YKhc9lC3FBZcwDh8BSEJZ8UNSlEeRQlK0iyJx+FCU6UFFAy0EpiOw2ddUVI/wdeKt8AKpin1rO/1kR061Pc9WVACTHlGcLqWIB47TOjoAUtYCxoslQDclc3whVMI9tKycV136F4c2+07VmQXt+GfGLr6IHyHGSOoEtzUlM+x0D2qeecPTT/cKtXLu8lkC1IRjOTeEn1y0coJ7on/t9dslZVtN12+ed/mR/8MtieOdphq2GycYHB4pD8ydJnW06x5r2PAeZxHt0lUzZo6zeKzXw==", RestApi="https://hestia.speckle.works/api", Email="giovanni.brogiolo@arup.com", Server="Speckle Hestia", StreamId="9T6Ikm8SY")  # unwired: B, C

# group: Rhynamo
string = StringInput("C:\Users\giovanni.brogiolo\Desktop\test1.3dm")
code_block_6 = CodeBlock { 1; }
DS_NurbsSurfaceToRhino = Interoperability.WriteRhino.CreateRhinoGeometry.DS_NurbsSurfaceToRhino(DynamoSurface=python_script_2)
DS_CurvesToRhino = Interoperability.WriteRhino.CreateRhinoGeometry.DS_CurvesToRhino(DynamoCurve=python_script)
code_block_7 = CodeBlock { "Srf"; }
code_block_8 = CodeBlock { 255; 0; }
create_RhinoColor = Interoperability.WriteRhino.CreateRhinoObjects.Create_RhinoColor(Red=code_block_8.out0, Green=code_block_8.out1, Blue=code_block_8.out1)
code_block_9 = CodeBlock { "From Revit"; }
create_RhinoLayer = Interoperability.WriteRhino.CreateRhinoObjects.Create_RhinoLayer(LayerName=code_block_9, LayerColor=create_RhinoColor)
code_block_10 = CodeBlock { "mm"; }

join = List.Join(list0=DS_NurbsSurfaceToRhino, list1=DS_CurvesToRhino)

# group (continued): Rhynamo
create_RhinoObject = Interoperability.WriteRhino.CreateRhinoObjects.Create_RhinoObject(RhinoGeometry=join, ObjName=code_block_7, ObjColor=create_RhinoColor, ObjLayer=create_RhinoLayer)
save_Rhino3dmModel = Interoperability.WriteRhino.SaveRhino3dmModel.Save_Rhino3dmModel(FilePath=string, SaveBool=code_block_6, RhinoObjects=create_RhinoObject, Units=code_block_10)
