# Dynamo graph speckle01.dyn (Dynamo 2.1.0.6255)

speckle_streams = Streams(RestApi="https://hestia.speckle.works/api/v1", Email="giobro@gmail.com", Server="Speckle Hestia", StreamId="S1fc4gvYX", Transmitting=false)
n26_09 = Receiver(ID=speckle_streams, DocumentName="Home", OldStreamId="S1fc4gvYX", myReceiver="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", RestApi="https://hestia.speckle.works/api/v1", Email="giobro@gmail.com", Server="Speckle Hestia", StreamId="S1fc4gvYX", Transmitting=false, Paused=false, StreamTextBoxEnabled=false)  # "26-09"
get = SpeckleDynamo.Data.UserData.Get(geometry=n26_09.B)
code_block = CodeBlock { "profile"; }
valueAtKey = DesignScript.Builtin.Dictionary.ValueAtKey(dictionary=get, key=code_block)
