# Dynamo graph speckleParser.dyn (Dynamo 2.0.1.4955)

speckle_streams = Streams(RestApi="http://speckle.arup.digital/api/v1", Email="giovanni.brogiolo@arup.com", Server="undefined", StreamId="Skxvdxhm7", Transmitting=false)
data_sender = Receiver(ID=speckle_streams, DocumentName="speckleParser", OldStreamId="Skxvdxhm7", myReceiver="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", RestApi="http://speckle.arup.digital/api/v1", Email="giovanni.brogiolo@arup.com", Server="undefined", StreamId="Skxvdxhm7", Transmitting=false, Paused=false, StreamTextBoxEnabled=false)
string = JsonData.Utilities.Parse.String(jsonString=data_sender.A)
code_block = CodeBlock { "properties"; }
getValueByKey = JsonObject.GetValueByKey(jsonObject=string, keys=code_block, Nesting=true, Option="None")
code_block_2 = CodeBlock { ["id","profile","material"]; }
getValueByKey_2 = JsonObject.GetValueByKey(jsonObject=getValueByKey, keys=code_block_2, Nesting=true, Option="None", lacing=CrossProduct)
code_block_3 = CodeBlock(geometry=data_sender.B) { geometry; }
