# Dynamo graph tableXml01.dyn (Dynamo 1.3.0.875)

code_block = CodeBlock { "ProgettoTest"; }
code_block_2 = CodeBlock { {"Elementi"}; }
code_block_3 = CodeBlock { {"idElement","Comments","Mark","Cut Length"}; }
select_model_elements = DSModelElementsSelection()  # 3 picked in the model
id = Element.Id(select_model_elements)
code_block_4 = CodeBlock { {"Comments","Mark","Cut Length"}; }
getParameterValueByName = Element.GetParameterValueByName(element=select_model_elements, parameterName=code_block_4, lacing=CrossProduct)
addItemToFront = List.AddItemToFront(item=id, list=getParameterValueByName, lacing=Longest)
createDataTable = Lists.DataSets.CreateDataTable(code_block_2, code_block_3, addItemToFront)
code_block_5 = CodeBlock(a=createDataTable) { a[0]; }
createDataSet = Lists.DataSets.CreateDataSet(code_block, code_block_5)
code_block_6 = CodeBlock { true; }
file_path = Filename("..\Desktop\export3.xml")
serializeXML = Lists.DataSets.SerializeXML(createDataSet, code_block_6, file_path, lacing=Longest)
