# Dynamo graph tagLeaderPosition.dyn (Dynamo 1.3.1.1736)

# group: Same as above but works with multiple elements
python_script = Python()  # unwired: IN[0]
# ---------- python_script.python (81 lines) ----------
#Copyright(c) 2015, Konrad K Sobon
# @arch_laboratory, http://archi-lab.net

import clr
clr.AddReference('ProtoGeometry')
from Autodesk.DesignScript.Geometry import *

# Import Element wrapper extension methods
clr.AddReference("RevitNodes")
import Revit
clr.ImportExtensions(Revit.Elements)

# Import geometry conversion extension methods
clr.ImportExtensions(Revit.GeometryConversion)

# Import DocumentManager and TransactionManager
clr.AddReference("RevitServices")
import RevitServices
from RevitServices.Persistence import DocumentManager
from RevitServices.Transactions import TransactionManager

doc = DocumentManager.Instance.CurrentDBDocument
uiapp = DocumentManager.Instance.CurrentUIApplication
app = uiapp.Application

# Import RevitAPI
clr.AddReference("RevitAPI")
import Autodesk
from Autodesk.Revit.DB import *

import sys
pyt_path = r'C:\Program Files (x86)\IronPython 2.7\Lib'
sys.path.append(pyt_path)

#The inputs to this node will be stored as a list in the IN variable.


def toRvtPoint(point):
	return point.ToXyz()

def toRvtId(_id):
	if isinstance(_id, int) or isinstance(_id, str):
		id = ElementId(int(_id))
		return id
	elif isinstance(_id, ElementId):
		return _id

def GetUVPoint(pt):
	if type(pt) == Autodesk.DesignScript.Geometry.Point:
		return Autodesk.Revit.DB.UV(pt.X, pt.Y)
	elif type(pt) == Autodesk.DesignScript.Geometry.UV:
		return Autodesk.Revit.DB.UV(pt.U, pt.V)

def CreateSpaceTag(space, uv, view):
	doc = DocumentManager.Instance.CurrentDBDocument
	return doc.Create.NewSpaceTag(space, uv, view)


tag = UnwrapElement(IN[0])

#leaderElbow = tag.LeaderElbow
#leaderEnd = tag.LeaderEnd
#newLeaderElbow = tag.LeaderElbow

#leaderX = tag.LeaderElbow[0]

changed = []
unchanged = []

TransactionManager.Instance.EnsureInTransaction(doc)

for item in tag:
	if item.LeaderElbow[0] != item.LeaderEnd[0]:
		item.LeaderElbow = XYZ(item.LeaderEnd[0], item.LeaderElbow[1], item.LeaderElbow[2])
		changed.append(item)
	else:
		unchanged.append(item)
	
TransactionManager.Instance.TransactionTaskDone()

OUT = [changed,unchanged]
# ----------------------------------------
select_model_elements = DSModelElementsSelection()  # 2 picked in the model

# group: Align the Elbow vertically. There must be a Leader and the Leader Type must be set to Free End and
select_model_element = DSModelElementSelection()  # 1 picked in the model
python_script_2 = Python()  # unwired: IN[0]
# ---------- python_script_2.python (76 lines) ----------
#Copyright(c) 2015, Konrad K Sobon
# @arch_laboratory, http://archi-lab.net

import clr
clr.AddReference('ProtoGeometry')
from Autodesk.DesignScript.Geometry import *

# Import Element wrapper extension methods
clr.AddReference("RevitNodes")
import Revit
clr.ImportExtensions(Revit.Elements)

# Import geometry conversion extension methods
clr.ImportExtensions(Revit.GeometryConversion)

# Import DocumentManager and TransactionManager
clr.AddReference("RevitServices")
import RevitServices
from RevitServices.Persistence import DocumentManager
from RevitServices.Transactions import TransactionManager

doc = DocumentManager.Instance.CurrentDBDocument
uiapp = DocumentManager.Instance.CurrentUIApplication
app = uiapp.Application

# Import RevitAPI
clr.AddReference("RevitAPI")
import Autodesk
from Autodesk.Revit.DB import *

import sys
pyt_path = r'C:\Program Files (x86)\IronPython 2.7\Lib'
sys.path.append(pyt_path)

#The inputs to this node will be stored as a list in the IN variable.


def toRvtPoint(point):
	return point.ToXyz()

def toRvtId(_id):
	if isinstance(_id, int) or isinstance(_id, str):
		id = ElementId(int(_id))
		return id
	elif isinstance(_id, ElementId):
		return _id

def GetUVPoint(pt):
	if type(pt) == Autodesk.DesignScript.Geometry.Point:
		return Autodesk.Revit.DB.UV(pt.X, pt.Y)
	elif type(pt) == Autodesk.DesignScript.Geometry.UV:
		return Autodesk.Revit.DB.UV(pt.U, pt.V)

def CreateSpaceTag(space, uv, view):
	doc = DocumentManager.Instance.CurrentDBDocument
	return doc.Create.NewSpaceTag(space, uv, view)


item = UnwrapElement(IN[0])

leaderElbow = item.LeaderElbow
leaderEnd = item.LeaderEnd
newLeaderElbow = item.LeaderElbow

leaderX = item.LeaderElbow[0]


TransactionManager.Instance.EnsureInTransaction(doc)

if item.LeaderElbow[0] != item.LeaderEnd[0]:
	item.LeaderElbow = XYZ(item.LeaderEnd[0], item.LeaderElbow[1], item.LeaderElbow[2])
	OUT = "changed"
else:
	OUT = "unchanged"
	
TransactionManager.Instance.TransactionTaskDone()
# ----------------------------------------

# group: Automatically add a Leader, set the Leader Type to Free End and align them
select_model_elements_2 = DSModelElementsSelection()  # 2 picked in the model
python_script_3 = Python(IN[0]=select_model_elements_2)
# ---------- python_script_3.python (85 lines) ----------
#Copyright(c) 2015, Konrad K Sobon
# @arch_laboratory, http://archi-lab.net

import clr
clr.AddReference('ProtoGeometry')
from Autodesk.DesignScript.Geometry import *

# Import Element wrapper extension methods
clr.AddReference("RevitNodes")
import Revit
clr.ImportExtensions(Revit.Elements)

# Import geometry conversion extension methods
clr.ImportExtensions(Revit.GeometryConversion)

# Import DocumentManager and TransactionManager
clr.AddReference("RevitServices")
import RevitServices
from RevitServices.Persistence import DocumentManager
from RevitServices.Transactions import TransactionManager

doc = DocumentManager.Instance.CurrentDBDocument
uiapp = DocumentManager.Instance.CurrentUIApplication
app = uiapp.Application

# Import RevitAPI
clr.AddReference("RevitAPI")
import Autodesk
from Autodesk.Revit.DB import *

import sys
pyt_path = r'C:\Program Files (x86)\IronPython 2.7\Lib'
sys.path.append(pyt_path)

#The inputs to this node will be stored as a list in the IN variable.


def toRvtPoint(point):
	return point.ToXyz()

def toRvtId(_id):
	if isinstance(_id, int) or isinstance(_id, str):
		id = ElementId(int(_id))
		return id
	elif isinstance(_id, ElementId):
		return _id

def GetUVPoint(pt):
	if type(pt) == Autodesk.DesignScript.Geometry.Point:
		return Autodesk.Revit.DB.UV(pt.X, pt.Y)
	elif type(pt) == Autodesk.DesignScript.Geometry.UV:
		return Autodesk.Revit.DB.UV(pt.U, pt.V)

def CreateSpaceTag(space, uv, view):
	doc = DocumentManager.Instance.CurrentDBDocument
	return doc.Create.NewSpaceTag(space, uv, view)


tag = UnwrapElement(IN[0])

#leaderElbow = tag.LeaderElbow
#leaderEnd = tag.LeaderEnd
#newLeaderElbow = tag.LeaderElbow

#leaderX = tag.LeaderElbow[0]

changed = []
unchanged = []

TransactionManager.Instance.EnsureInTransaction(doc)

for item in tag:

#	IndependentTag.Create()
    item.LeaderEndCondition = LeaderEndCondition.Free
    elbowPnt = XYZ(item.LeaderEnd[0], item.LeaderEnd[1]-1, item.LeaderEnd[2])
    item.LeaderElbow = elbowPnt
    headerPnt = XYZ(item.LeaderEnd[0]+3, elbowPnt[1]+0.18, elbowPnt[2])
    item.TagHeadPosition = headerPnt
"""
	item.LeaderElbow = XYZ(item.LeaderEnd[0], item.LeaderElbow[1], item.LeaderElbow[2])
	"""
TransactionManager.Instance.TransactionTaskDone()

OUT = [changed,unchanged]
# ----------------------------------------

python_script_4 = Python()  # unwired: IN[0]
# ---------- python_script_4.python (81 lines) ----------
#Copyright(c) 2015, Konrad K Sobon
# @arch_laboratory, http://archi-lab.net

import clr
clr.AddReference('ProtoGeometry')
from Autodesk.DesignScript.Geometry import *

# Import Element wrapper extension methods
clr.AddReference("RevitNodes")
import Revit
clr.ImportExtensions(Revit.Elements)

# Import geometry conversion extension methods
clr.ImportExtensions(Revit.GeometryConversion)

# Import DocumentManager and TransactionManager
clr.AddReference("RevitServices")
import RevitServices
from RevitServices.Persistence import DocumentManager
from RevitServices.Transactions import TransactionManager

doc = DocumentManager.Instance.CurrentDBDocument
uiapp = DocumentManager.Instance.CurrentUIApplication
app = uiapp.Application

# Import RevitAPI
clr.AddReference("RevitAPI")
import Autodesk
from Autodesk.Revit.DB import *

import sys
pyt_path = r'C:\Program Files (x86)\IronPython 2.7\Lib'
sys.path.append(pyt_path)

#The inputs to this node will be stored as a list in the IN variable.


def toRvtPoint(point):
	return point.ToXyz()

def toRvtId(_id):
	if isinstance(_id, int) or isinstance(_id, str):
		id = ElementId(int(_id))
		return id
	elif isinstance(_id, ElementId):
		return _id

def GetUVPoint(pt):
	if type(pt) == Autodesk.DesignScript.Geometry.Point:
		return Autodesk.Revit.DB.UV(pt.X, pt.Y)
	elif type(pt) == Autodesk.DesignScript.Geometry.UV:
		return Autodesk.Revit.DB.UV(pt.U, pt.V)

def CreateSpaceTag(space, uv, view):
	doc = DocumentManager.Instance.CurrentDBDocument
	return doc.Create.NewSpaceTag(space, uv, view)


tag = UnwrapElement(IN[0])

#leaderElbow = tag.LeaderElbow
#leaderEnd = tag.LeaderEnd
#newLeaderElbow = tag.LeaderElbow

#leaderX = tag.LeaderElbow[0]

changed = []
unchanged = []

TransactionManager.Instance.EnsureInTransaction(doc)

for item in tag:

	IndependentTag.Create()

"""
	item.LeaderElbow = XYZ(item.LeaderEnd[0], item.LeaderElbow[1], item.LeaderElbow[2])
	"""
TransactionManager.Instance.TransactionTaskDone()

OUT = [changed,unchanged]
# ----------------------------------------
