# Dynamo graph tekla.dyn (Dynamo 1.3.2.2480)

# group: CREATE BEAM BY CURVE
code_block = CodeBlock { {5000,7000}; }
code_block_2 = CodeBlock { 0; }
byCoordinates = Point.ByCoordinates(x=code_block, z=code_block_2)
code_block_3 = CodeBlock { 5000; }
byCoordinates_2 = Point.ByCoordinates(x=code_block_3, y=code_block_3, z=code_block_2)
byStartPointEndPoint = Line.ByStartPointEndPoint(startPoint=byCoordinates, endPoint=byCoordinates_2, lacing=Longest)
code_block_4 = CodeBlock { 500; 300; }
code_block_5 = CodeBlock { "Concrete"; }
code_block_6 = CodeBlock { "MIDDLE"; }

# group: CREATE GRID PLANE
gridPlane = Arup.DynaTekla.Tekla.GridPlane()  # unwired: arg0

# group: CREATE GRID
string = StringInput(""" Name = "Grid";
 CoordinateX = "0.00 4*3000.00";
 CoordinateY = "0.00 5*6000.00";
 CoordinateZ = "0.00 6000.00 8000.00 9000.00";
 LabelX = "A B C D E";
 LabelY = "1 2 3 4 5 6";
 LabelZ = "+0 +6000 +8000 +9000";
 ExtensionLeftX = 2000.0;
 ExtensionLeftY = 2000.0;
 ExtensionLeftZ = 2000.0;
 ExtensionRightX = 2000.0;
 ExtensionRightY = 2000.0;
 ExtensionRightZ = 2000.0;
 IsMagnetic = false;""")
code_block_7 = CodeBlock { "0.00 6000.00 8000.00 9000.00"; }
code_block_8 = CodeBlock { "0.0 4600.00 8600 13200"; }
code_block_9 = CodeBlock { "0.00 -4000 -9000"; }
code_block_10 = CodeBlock { "0.0"; }

# group: CREATE PAD FOOTING
positionPlane = Arup.DynaTekla.Tekla.PositionPlane()
watch = Watch(positionPlane)
code_block_11 = CodeBlock { "Pad Footing"; }
code_block_12 = CodeBlock { "2000*3000"; }
code_block_13 = CodeBlock { "Concrete"; }
code_block_14 = CodeBlock { 5000; }
code_block_15 = CodeBlock { 0; }
code_block_16 = CodeBlock { 1000; }
code_block_17 = CodeBlock { "3"; }

categories = Categories("Grids")
all_elements_of_category = ElementsOfCategory(categories)
curve = Grid.Curve(all_elements_of_category)
intersectAll = Curve.IntersectAll(curve)
deconstructPoint = Geometry.Points.DeconstructPoint(intersectAll)
round = Math.Round(deconstructPoint.out0)
uniqueItems = List.UniqueItems(round)
python_script = Python(IN[0]=uniqueItems)
# ---------- python_script.python (16 lines) ----------
import clr
clr.AddReference('ProtoGeometry')
from Autodesk.DesignScript.Geometry import *
#The inputs to this node will be stored as a list in the IN variables.

list = IN[0]

newList = [list[0]]

for i in range(0,len(list)-1):
	newList.append(list[i+1]-list[i])

str1 = ' '.join(str(e) for e in newList)

#Assign your output to the OUT variable.
OUT = str1
# ----------------------------------------
select_model_elements = DSModelElementsSelection()
location = StructuralFraming.Location(select_model_elements)
round_2 = Math.Round(deconstructPoint.out1)
uniqueItems_2 = List.UniqueItems(round_2)
python_script_2 = Python(IN[0]=uniqueItems_2)  # same code as python_script
code_block_18 = CodeBlock { {"Dimensions_Height_Nominal","Dimensions_Width_Nominal"}; }
getParameterValueByName = Element.GetParameterValueByName(element=select_model_elements)  # unwired: parameterName
deconstruct = List.Deconstruct(list=getParameterValueByName)
select_model_elements_2 = DSModelElementsSelection()

# group: CREATE MULTIPLE BEAMS
code_block_19 = CodeBlock { {"Dimensions_Height_Nominal","Dimensions_Width_Nominal"}; }
getParameterValueByName_2 = Element.GetParameterValueByName(element=select_model_elements_2, lacing=CrossProduct)  # unwired: parameterName
deconstruct_2 = List.Deconstruct(list=getParameterValueByName_2, lacing=Longest)
location_2 = StructuralFraming.Location(select_model_elements_2)
code_block_20 = CodeBlock { "Concrete"; }

code_block_21 = CodeBlock { "UB180*18"; }
code_block_22 = CodeBlock { 'a'; }
overallPosition = Arup.DynaTekla.Positions.OverallPosition()
code_block_23 = CodeBlock { "Steel_Undefined"; }
genericBeam = Arup.DynaTekla.TeklaSteel.GenericBeam(arg1=code_block_21, arg2=code_block_22, arg3=overallPosition, arg4=code_block_23)  # unwired: arg0
grid = Arup.DynaTekla.TeklaGrids.Grid(code_block_8, code_block_9, code_block_10)  # frozen
positionPlane_2 = Arup.DynaTekla.Positions.PositionPlane()
padFooting = Arup.DynaTekla.TeklaConcrete.PadFooting(positionPlane_2.out1, code_block_11, code_block_12, code_block_13, code_block_14, code_block_15, code_block_16, code_block_14, code_block_17)  # frozen
getAllBeams = Arup.DynaTekla.TeklaSelect.GetAllBeams()
beamNames = Arup.DynaTekla.TeklaSelect.BeamNames(getAllBeams)
selectObjectTypeGrid = Arup.DynaTekla.TeklaSelect.SelectObjectTypeGrid()
getObjectsByType = Arup.DynaTekla.TeklaSelect.GetObjectsByType(selectObjectTypeGrid)

# group: GET OBJECTS BY TYPE
code_block_24 = CodeBlock { {"UNKNOWN","BEAM","POLYBEAM","CONTOURPLATE","BOOLEANPART","GRID"}; }
code_block_25 = CodeBlock { {0,1,2,3,4,22}; }
createDictionary = Lists.Dictionary.CreateDictionary(code_block_24, code_block_25)
code_block_26 = CodeBlock { "BEAM"; }
getValueFromDictionary = Lists.Dictionary.GetValueFromDictionary(createDictionary, code_block_26)

getObjectsByType_2 = Arup.DynaTekla.TeklaSelect.GetObjectsByType(getValueFromDictionary)
string_2 = StringInput("500x300")
positionPlane_3 = Arup.DynaTekla.Positions.PositionPlane()
genericBeam_2 = Arup.DynaTekla.TeklaConcrete.GenericBeam(location_2, string_2, arg3=positionPlane_3.out2, arg4=code_block_20)  # frozen; unwired: arg2
byCoordinates_3 = Point.ByCoordinates()
constructionLine = Arup.DynaTekla.Construction.ConstructionLine(byCoordinates_3, byCoordinates_2)
