# Dynamo graph tekla02.dyn (Dynamo 1.3.2.2480)

select_model_elements = DSModelElementsSelection()
location = StructuralFraming.Location(select_model_elements)
code_block = CodeBlock { {"Dimensions_Height_Nominal","Dimensions_Width_Nominal"}; }
getParameterValueByName = Element.GetParameterValueByName(element=select_model_elements, parameterName=code_block)
deconstruct = List.Deconstruct(list=getParameterValueByName)

# group: CREATE BEAM BY CURVE
code_block_2 = CodeBlock { {5000,7000}; }
code_block_3 = CodeBlock { 50000; }
byCoordinates = Point.ByCoordinates(x=code_block_2, z=code_block_3)
code_block_4 = CodeBlock { 7000; }
byCoordinates_2 = Point.ByCoordinates(x=code_block_4, y=code_block_4, z=code_block_3)
byStartPointEndPoint = Line.ByStartPointEndPoint(startPoint=byCoordinates, endPoint=byCoordinates_2, lacing=Longest)
code_block_5 = CodeBlock { 500; 300; }
code_block_6 = CodeBlock { "Concrete"; }
code_block_7 = CodeBlock { "MIDDLE"; }
beam = Arup.DynaTekla.Tekla.Beam(location, deconstruct.first, deconstruct.rest, code_block_6, code_block_7)

# group: CREATE GRID
grid = Arup.DynaTekla.Tekla.Grid()  # unwired: arg0, arg1, arg2
string = StringInput(""" Name = "Grid";
 CoordinateX = "0.00 4*3000.00";
 CoordinateY = "0.00 5*6000.00";
 CoordinateZ = "0.00 6000.00 8000.00 9000.00";
 LabelX = "A B C D E";
 LabelY = "1 2 3 4 5 6";
 LabelZ = "+0 +6000 +8000 +9000";
 ExtensionLeftX = 2000.0;
 ExtensionLeftY = 2000.0;
 ExtensionLeftZ = 2000.0;
 ExtensionRightX = 2000.0;
 ExtensionRightY = 2000.0;
 ExtensionRightZ = 2000.0;
 IsMagnetic = false;""")
code_block_8 = CodeBlock { "0.0 4600.00 8600 13200"; }
code_block_9 = CodeBlock { "0.00 -4000 -9000"; }
code_block_10 = CodeBlock { "0.00 6000.00 8000.00 9000.00"; }
code_block_11 = CodeBlock { "0.0"; }

# group: CREATE GRID PLANE
gridPlane = Arup.DynaTekla.Tekla.GridPlane()  # unwired: arg0

# group: CREATE PAD FOOTING
code_block_12 = CodeBlock { "Pad Footing"; }
code_block_13 = CodeBlock { "2000*3000"; }
code_block_14 = CodeBlock { "Concrete"; }
code_block_15 = CodeBlock { 5000; }
code_block_16 = CodeBlock { 0; }
code_block_17 = CodeBlock { 1000; }
code_block_18 = CodeBlock { "3"; }
createPadFooting = Arup.DynaTekla.Tekla.CreatePadFooting(arg1=code_block_12, arg2=code_block_13, arg3=code_block_14, arg4=code_block_15, arg5=code_block_16, arg6=code_block_17, arg7=code_block_15, arg8=code_block_18)  # unwired: arg0
positionPlane = Arup.DynaTekla.Tekla.PositionPlane()
watch = Watch(positionPlane)

getAllBeams = Arup.DynaTekla.Tekla.GetAllBeams()

# group: GET ALL BEAMS
beamNames = Arup.DynaTekla.Tekla.BeamNames(getAllBeams)
getAllBeams_2 = Arup.DynaTekla.Tekla.GetAllBeams()

objectType = Arup.DynaTekla.Tekla.ObjectType()
type = Object.Type(objectType)
getObjectsByType = Arup.DynaTekla.Tekla.GetObjectsByType(objectType)

# group: GET OBJECTS BY TYPE
code_block_19 = CodeBlock { {"UNKNOWN","BEAM","POLYBEAM","CONTOURPLATE","BOOLEANPART","GRID"}; }
code_block_20 = CodeBlock { {0,1,2,3,4,22}; }
createDictionary = Lists.Dictionary.CreateDictionary(code_block_19, code_block_20)
code_block_21 = CodeBlock { "BEAM"; }
getValueFromDictionary = Lists.Dictionary.GetValueFromDictionary(createDictionary, code_block_21)
getObjectsByType_2 = Arup.DynaTekla.Tekla.GetObjectsByType(getValueFromDictionary)

beamNames_2 = Arup.DynaTekla.Tekla.BeamNames(getObjectsByType_2)
categories = Categories("Grids")
all_elements_of_category = ElementsOfCategory(categories)
curve = Grid.Curve(all_elements_of_category)
intersectAll = Curve.IntersectAll(curve)
deconstructPoint = Geometry.Points.DeconstructPoint(intersectAll)
round = Math.Round(deconstructPoint.out0)
uniqueItems = List.UniqueItems(round)
python_script = Python(IN[0]=uniqueItems)
# ---------- python_script.python (16 lines) ----------
import clr
clr.AddReference('ProtoGeometry')
from Autodesk.DesignScript.Geometry import *
#The inputs to this node will be stored as a list in the IN variables.

list = IN[0]

newList = [list[0]]

for i in range(0,len(list)-1):
	newList.append(list[i+1]-list[i])

str1 = ' '.join(str(e) for e in newList)

#Assign your output to the OUT variable.
OUT = str1
# ----------------------------------------
round_2 = Math.Round(deconstructPoint.out1)
uniqueItems_2 = List.UniqueItems(round_2)
python_script_2 = Python(IN[0]=uniqueItems_2)  # same code as python_script
select_model_elements_2 = DSModelElementsSelection()  # 2 picked in the model
grid_2 = Arup.DynaTekla.Grids.Grid()  # unwired: arg0, arg1, arg2
round_3 = Math.Round(deconstructPoint.out2)
categories_2 = Categories("Levels")
all_elements_of_category_2 = ElementsOfCategory(categories_2)
elevation = Level.Elevation(all_elements_of_category_2)
uniqueItems_3 = List.UniqueItems(elevation)
python_script_3 = Python(IN[0]=uniqueItems_3)  # same code as python_script
name = Level.Name(all_elements_of_category_2)
code_block_22 = CodeBlock { 0; }
name_2 = Element.Name(all_elements_of_category)
direction = Line.Direction(curve)
X = Vector.X(direction)
code_block_23 = CodeBlock { 0; }
ne = X != code_block_23
filterByBoolMask = List.FilterByBoolMask(list=name_2, mask=ne)
code_block_24 = CodeBlock { 200; }
code_block_25 = CodeBlock { 300; }

# group: CREATE MULTIPLE BEAMS
code_block_26 = CodeBlock { {"Dimensions_Height_Nominal","Dimensions_Width_Nominal"}; }
getParameterValueByName_2 = Element.GetParameterValueByName(element=select_model_elements_2, parameterName=code_block_26, lacing=CrossProduct)
location_2 = StructuralFraming.Location(select_model_elements_2)
code_block_27 = CodeBlock { "Steel_Undefined"; }
code_block_28 = CodeBlock { "MIDDLE"; }
teklaBeam = Arup.DynaTekla.Steel.TeklaBeam(location_2, code_block_24, code_block_25, code_block_27, code_block_28)

beam2Pt = Arup.DynaTekla.Steel.Beam2Pt()  # unwired: arg0, arg1
overallPosition = Arup.DynaTekla.Positions.OverallPosition()
