# Dynamo graph tekla03.dyn (Dynamo 1.3.3.4651)

# group: CREATE BEAM BY CURVE
code_block = CodeBlock { {5000,7000}; }
code_block_2 = CodeBlock { 50000; }
byCoordinates = Point.ByCoordinates(x=code_block, z=code_block_2)
code_block_3 = CodeBlock { 7000; }
byCoordinates_2 = Point.ByCoordinates(x=code_block_3, y=code_block_3, z=code_block_2)
byStartPointEndPoint = Line.ByStartPointEndPoint(startPoint=byCoordinates, endPoint=byCoordinates_2, lacing=Longest)
code_block_4 = CodeBlock { 500; 300; }
code_block_5 = CodeBlock { "Concrete"; }
overallPosition = Arup.DynaTekla.Positions.OverallPosition()

# group: CREATE GRID
string = StringInput(""" Name = "Grid";
 CoordinateX = "0.00 4*3000.00";
 CoordinateY = "0.00 5*6000.00";
 CoordinateZ = "0.00 6000.00 8000.00 9000.00";
 LabelX = "A B C D E";
 LabelY = "1 2 3 4 5 6";
 LabelZ = "+0 +6000 +8000 +9000";
 ExtensionLeftX = 2000.0;
 ExtensionLeftY = 2000.0;
 ExtensionLeftZ = 2000.0;
 ExtensionRightX = 2000.0;
 ExtensionRightY = 2000.0;
 ExtensionRightZ = 2000.0;
 IsMagnetic = false;""")
code_block_6 = CodeBlock { "0.0"; }
code_block_7 = CodeBlock { "0.0 4600.00 8600 13200"; }
code_block_8 = CodeBlock { "0.00 -4000 -9000"; }
code_block_9 = CodeBlock { "0.00 6000.00 8000.00 9000.00"; }

categories = Categories("Grids")
all_elements_of_category = ElementsOfCategory(categories)
curve = Grid.Curve(all_elements_of_category)
intersectAll = Curve.IntersectAll(curve)
deconstructPoint = Geometry.Points.DeconstructPoint(intersectAll)
round = Math.Round(deconstructPoint.out2)
categories_2 = Categories("Levels")
all_elements_of_category_2 = ElementsOfCategory(categories_2)
name = Level.Name(all_elements_of_category_2)
code_block_10 = CodeBlock { 0; }
name_2 = Element.Name(all_elements_of_category)
direction = Line.Direction(curve)
X = Vector.X(direction)
code_block_11 = CodeBlock { 0; }
ne = X != code_block_11
filterByBoolMask = List.FilterByBoolMask(list=name_2, mask=ne)
grid = Arup.DynaTekla.TeklaGrids.Grid(code_block_7, code_block_8, code_block_9)
round_2 = Math.Round(deconstructPoint.out0)
uniqueItems = List.UniqueItems(round_2)
python_script = Python(IN[0]=uniqueItems)
# ---------- python_script.python (16 lines) ----------
import clr
clr.AddReference('ProtoGeometry')
from Autodesk.DesignScript.Geometry import *
#The inputs to this node will be stored as a list in the IN variables.

list = IN[0]

newList = [list[0]]

for i in range(0,len(list)-1):
	newList.append(list[i+1]-list[i])

str1 = ' '.join(str(e) for e in newList)

#Assign your output to the OUT variable.
OUT = str1
# ----------------------------------------
round_3 = Math.Round(deconstructPoint.out1)
uniqueItems_2 = List.UniqueItems(round_3)
python_script_2 = Python(IN[0]=uniqueItems_2)  # same code as python_script
elevation = Level.Elevation(all_elements_of_category_2)
uniqueItems_3 = List.UniqueItems(elevation)
python_script_3 = Python(IN[0]=uniqueItems_3)  # same code as python_script
grid_2 = Arup.DynaTekla.TeklaGrids.Grid(python_script, python_script_2, python_script_3)

# group: CREATE GRID PLANE
gridPlane = Arup.DynaTekla.TeklaGrids.GridPlane()  # unwired: arg0

select_model_elements = DSModelElementsSelection()
location = StructuralFraming.Location(select_model_elements)
code_block_12 = CodeBlock { {"Dimensions_Height_Nominal","Dimensions_Width_Nominal"}; }
getParameterValueByName = Element.GetParameterValueByName(element=select_model_elements, parameterName=code_block_12)
deconstruct = List.Deconstruct(list=getParameterValueByName)
rectangularBeam = Arup.DynaTekla.TeklaSteel.RectangularBeam(location, deconstruct.first, deconstruct.rest, code_block_5, overallPosition)

# group: CREATE PAD FOOTING
positionPlane = Arup.DynaTekla.Positions.PositionPlane()
code_block_13 = CodeBlock { "Pad Footing"; }
code_block_14 = CodeBlock { "2000*3000"; }
code_block_15 = CodeBlock { "Concrete"; }
code_block_16 = CodeBlock { 5000; }
code_block_17 = CodeBlock { 0; }
code_block_18 = CodeBlock { 1000; }
code_block_19 = CodeBlock { "3"; }
padFooting = Arup.DynaTekla.TeklaConcrete.PadFooting(positionPlane.out1, code_block_13, code_block_14, code_block_15, code_block_16, code_block_17, code_block_18, code_block_16, code_block_19)

# group: GET OBJECTS BY TYPE
code_block_20 = CodeBlock { {"UNKNOWN","BEAM","POLYBEAM","CONTOURPLATE","BOOLEANPART","GRID"}; }
code_block_21 = CodeBlock { {0,1,2,3,4,22}; }
createDictionary = Lists.Dictionary.CreateDictionary(code_block_20, code_block_21)
code_block_22 = CodeBlock { "BEAM"; }
getValueFromDictionary = Lists.Dictionary.GetValueFromDictionary(createDictionary, code_block_22)

getObjectsByType = Arup.DynaTekla.TeklaSelect.GetObjectsByType(getValueFromDictionary)
beamNames = Arup.DynaTekla.TeklaSelect.BeamNames(getObjectsByType)
getAllBeams = Arup.DynaTekla.TeklaSelect.GetAllBeams()
