# Dynamo graph teklaPanel.dyn (Dynamo 1.3.2.2480)

# group: Line
code_block = CodeBlock { Line.ByStartPointEndPoint(Point.ByCoordinates(0,0,0), Point.ByCoordinates(5000,0,0)); }

code_block_2 = CodeBlock { 500; 3333; }
code_block_3 = CodeBlock { "Wall23"; }
code_block_4 = CodeBlock { "Front"; }
overallPosition = Arup.DynaTekla.Positions.OverallPosition(code_block_4)
code_block_5 = CodeBlock { "Concrete_Undefined"; }
teklaPanel = Arup.DynaTekla.Concrete.TeklaPanel(code_block, code_block_2.out0, code_block_2.out1, code_block_3, overallPosition, code_block_5)
flatten = Flatten(teklaPanel)
selectObjects = Arup.DynaTekla.Select.SelectObjects()  # frozen
code_block_6 = CodeBlock { "myname2"; }
modifyPanel = Arup.DynaTekla.Concrete.ModifyPanel(selectObjects, arg3=code_block_6)
