# Dynamo graph tendonds01.dyn (Dynamo 2.0.1.4955)

file_path = Filename("C:\Users\giovanni.brogiolo\Desktop\out.csv")
file_from_path = FileObject(path=file_path)
code_block = CodeBlock { "out"; }
code_block_2 = CodeBlock { 1; }
importCSV = Data.ImportCSV(filePath=file_path, transpose=code_block_2)
code_block_3 = CodeBlock { [10,11,7]; }
getItemAtIndex = List.GetItemAtIndex(list=importCSV, index=code_block_3, lacing=CrossProduct)
deconstruct = List.Deconstruct(list=getItemAtIndex)
python_script = Python(IN[0]=deconstruct.rest)
# ---------- python_script.python (8 lines) ----------
import clr

clr.AddReference('ProtoGeometry')
from Autodesk.DesignScript.Geometry import Point as Pt

pts = IN[0]

OUT = [Pt.ByCoordinates(p[0]*100,p[1]*100,p[2]) for p in pts]
# ----------------------------------------
code_block_4 = CodeBlock { [18,19,15]; }
getItemAtIndex_2 = List.GetItemAtIndex(list=importCSV, index=code_block_4, lacing=CrossProduct)
deconstruct_2 = List.Deconstruct(list=getItemAtIndex_2)
python_script_2 = Python(IN[0]=deconstruct_2.rest)  # same code as python_script
byStartPointEndPoint = Line.ByStartPointEndPoint(startPoint=python_script, endPoint=python_script_2)
group_curves = Custom[Group Curves](Curves=byStartPointEndPoint)  # This node will take any input of flat list of curves and group them into sublists containing "joinable" curves that is continous curves. They might form closed curves or open curves. Use PolyCurve.ByJoinedCurves to convert output groups of curves into single PolyCurves
toNurbsCurve = Curve.ToNurbsCurve(curve=group_curves)
controlPoints = NurbsCurve.ControlPoints(nurbsCurve=toNurbsCurve)
code_block_5 = CodeBlock { 2; }
flatten = List.Flatten(list=controlPoints@L3, amt=code_block_5)
X = Point.X()  # unwired: point
sortByFunction = List.SortByFunction(list=flatten, func=X, lacing=Longest)
pruneDuplicates = Point.PruneDuplicates(points=sortByFunction, lacing=Longest)
code_block_6 = CodeBlock { 3; }
byControlPoints = NurbsCurve.ByControlPoints(points=pruneDuplicates, degree=code_block_6)
levels = Levels(index=0)
structural_framing_types = StructuralFramingTypes(index=0)
beamByCurve = StructuralFraming.BeamByCurve(curve=byControlPoints, level=levels, structuralFramingType=structural_framing_types)
python_script_3 = Python(IN[0]=group_curves)
# ---------- python_script_3.python (15 lines) ----------
import clr

clr.AddReference('ProtoGeometry')

crvs = IN[0]
pts = []

for c in crvs:
	subList= []
	pts.append(subList)
	for item in c:
		subList.append(item.PointAtParameter(0))
		subList.append(item.PointAtParameter(1))

OUT = pts
# ----------------------------------------
pruneDuplicates_2 = Point.PruneDuplicates(points=python_script_3, lacing=Longest)
X_2 = Point.X()  # unwired: point
sortByFunction_2 = List.SortByFunction(list=pruneDuplicates_2, func=X_2, lacing=Longest)
