# Dynamo graph test1.dyn (Dynamo 1.3.1.1736)

rotate_family = Custom[Rotate Family]()  # This node will rotate a family in Revit around a given axis by supplied angle (in radians). Please remember that every time you run your definition it will rotate family by given angle every time.; unwired: ElementId, Axis, Angle
setRotation = FamilyInstance.SetRotation()  # unwired: familyInstance, degree
code_block = CodeBlock { 45; }
rotate_families_around_origin_by = Custom[Rotate Families Around Origin by Angle](DegreesToRotate=code_block)  # this will take Family Instance and angles as list inputs, and rotate Families around their origin. Outputs provide feedback on information used.; unwired: FamilyElement
select_model_elements = DSModelElementsSelection()
code_block_2 = CodeBlock { FamilyElement; }  # unwired: FamilyElement
getLocation = Element.GetLocation(code_block_2)
code_block_3 = CodeBlock(InstanceOriginPoint=getLocation) { InstanceOriginPoint; }
X = Point.X(getLocation)
Y = Point.Y(getLocation)
number = DoubleInput(-2000)
sum = Math.Sum(number)
byCoordinates = Point.ByCoordinates(x=X, y=Y, z=sum)
byStartPointEndPoint = Line.ByStartPointEndPoint(startPoint=getLocation, endPoint=byCoordinates)
code_block_4 = CodeBlock(AxisUsed=byStartPointEndPoint) { AxisUsed; }
code_block_5 = CodeBlock(PointProjectedToMakeAxis=byCoordinates) { PointProjectedToMakeAxis; }
location = FamilyInstance.Location()  # unwired: arg0
element_ids = Custom[Element Ids](Element_s=code_block_2)  # This node will query an element id that can be used with Revit nodes. Dynamo Element Id node returns integer value.
flatten = Flatten(element_ids.Id_String_s)
code_block_6 = CodeBlock { 45; }
code_block_7 = CodeBlock(DegreesToRotate=code_block_6) { DegreesToRotate; }
degreesToRadians = Math.DegreesToRadians(code_block_7)
rotate_family_2 = Custom[Rotate Family](ElementId=flatten, Axis=byStartPointEndPoint, Angle=degreesToRadians)
code_block_8 = CodeBlock(RotatedItems=rotate_family_2) { RotatedItems; }
code_block_9 = CodeBlock(Ids=flatten) { Ids; }
select_model_elements_2 = DSModelElementsSelection()  # 1 picked in the model
id = Element.Id(select_model_elements_2)
code_block_10 = CodeBlock(ids=id) { DSCore.List.Flatten({ids},10); }
getLocation_2 = Element.GetLocation(select_model_elements_2)
deconstructPoint = Geometry.Points.DeconstructPoint(getLocation_2)
code_block_11 = CodeBlock(a=deconstructPoint.out2) { a+10; }
byCoordinates_2 = Point.ByCoordinates(x=deconstructPoint.out0, y=deconstructPoint.out1, z=code_block_11)
byStartPointEndPoint_2 = Line.ByStartPointEndPoint(startPoint=getLocation_2, endPoint=byCoordinates_2)
code_block_12 = CodeBlock(lines=byStartPointEndPoint_2) { DSCore.List.Flatten({lines},10); }
code_block_13 = CodeBlock { 30; }
degreesToRadians_2 = Math.DegreesToRadians(code_block_13)
code_block_14 = CodeBlock(deg=degreesToRadians_2) { DSCore.List.Flatten({deg},10); }
python_script = Python(IN[0]=code_block_10, IN[1]=code_block_12, IN[2]=code_block_14)
# ---------- python_script.python (61 lines) ----------
#Copyright(c) 2015, Konrad Sobon
# @arch_laboratory, http://archi-lab.net

import clr
clr.AddReference('ProtoGeometry')
from Autodesk.DesignScript.Geometry import *

# Import ToDSType(bool) extension method
clr.AddReference("RevitNodes")
import Revit
clr.ImportExtensions(Revit.Elements)

# Import DocumentManager and TransactionManager
clr.AddReference("RevitServices")
import RevitServices
from RevitServices.Persistence import DocumentManager
from RevitServices.Transactions import TransactionManager

from System.Collections.Generic import *

# Import RevitAPI
clr.AddReference("RevitAPI")
import Autodesk
from Autodesk.Revit.DB import *

doc = DocumentManager.Instance.CurrentDBDocument
uiapp = DocumentManager.Instance.CurrentUIApplication
app = uiapp.Application

# Import geometry conversion extension methods
clr.ImportExtensions(Revit.GeometryConversion)

#The inputs to this node will be stored as a list in the IN variable.
dataEnteringNode = IN

def toRvtId(_id):
	if isinstance(_id, int) or isinstance(_id, str):
		id = ElementId(int(_id))
		return id
	elif isinstance(_id, ElementId):
		return _id

lmntIds, axises, angles = [], [], []
for i, j in zip(IN[0], IN[1]):
	lmntIds.append(toRvtId(UnwrapElement(i)))
	axises.append(j.ToRevitType())
angles = IN[2]

# "Start" the transaction
TransactionManager.Instance.EnsureInTransaction(doc)

elements = []
for axis_, angle_, lmntId_ in zip(axises, angles, lmntIds):
	Autodesk.Revit.DB.ElementTransformUtils.RotateElement(doc, lmntId_, axis_, angle_)
	elements.append(doc.GetElement(lmntId_))

# "End" the transaction
TransactionManager.Instance.TransactionTaskDone()

#Assign your output to the OUT variable
OUT = elements
# ----------------------------------------
