# Dynamo graph testmep.dyn (Dynamo 1.3.1.1736)

pipesFromDWGLines = Custom[PipesFromDWGLines]()  # unwired: T, Elbow, Pipe_Type, Levels
code_block = CodeBlock { T; }  # unwired: T
flatten = Flatten(code_block)
code_block_2 = CodeBlock { Elbow; }  # unwired: Elbow
flatten_2 = Flatten(code_block_2)
join = List.Join(flatten, flatten_2)
count = List.Count(flatten)
count_2 = List.Count(flatten_2)
code_block_3 = CodeBlock(a=count, b=count_2) { {a,b}; }
code_block_4 = CodeBlock { Levels; }  # unwired: Levels
select_model_elements = DSModelElementsSelection()  # 4 picked in the model
curves = Element.Curves(select_model_elements)
code_block_5 = CodeBlock { {0,1}; }
pointAtParameter = Curve.PointAtParameter(curve=curves@L1, param=code_block_5, lacing=CrossProduct)
code_block_6 = CodeBlock(a=pointAtParameter) { {a[0][0],a[0][1],a[1][1]}; }
python_script = Python(IN[0]=code_block_6)  # unwired: IN[1], IN[2], IN[3]
# ---------- python_script.python (36 lines) ----------
import clr

clr.AddReference("RevitServices")
import RevitServices
from RevitServices.Persistence import DocumentManager
from RevitServices.Transactions import TransactionManager
doc = DocumentManager.Instance.CurrentDBDocument

clr.AddReference("RevitAPI")
import Autodesk
from Autodesk.Revit.DB import *

clr.AddReference("RevitNodes")
import Revit
clr.ImportExtensions(Revit.Elements)
clr.ImportExtensions(Revit.GeometryConversion)

toggle = ""

pts = IN[0]
pipetype = UnwrapElement(IN[1])
systemtype = UnwrapElement(IN[2])
level = UnwrapElement(IN[3])


elements = []

TransactionManager.Instance.EnsureInTransaction(doc)
for i in range(1,len(pts)):
	pipe = Autodesk.Revit.DB.Plumbing.Pipe.CreatePlaceholder(doc,systemtype.Id,pipetype.Id,level.Id,pts[i].ToXyz(),pts[i-1].ToXyz())
	elements.append(pipe.ToDSType(False))

TransactionManager.Instance.TransactionTaskDone()


OUT = elements
# ----------------------------------------
pipesFromDWGLines_2 = Custom[PipesFromDWGLines]()  # unwired: T, Elbow, Pipe_Type, Levels
python_script_2 = Python()  # unwired: IN[0]
# ---------- python_script_2.python (39 lines) ----------
import clr

clr.AddReference("RevitServices")
import RevitServices
from RevitServices.Persistence import DocumentManager
from RevitServices.Transactions import TransactionManager
doc = DocumentManager.Instance.CurrentDBDocument

clr.AddReference("RevitAPI")
import Autodesk
from Autodesk.Revit.DB import *

clr.AddReference("RevitNodes")
import Revit
clr.ImportExtensions(Revit.Elements)
clr.ImportExtensions(Revit.GeometryConversion)

clr.AddReference("System")
from System.Collections.Generic import List

pipes = UnwrapElement(IN[0])


elements = []

TransactionManager.Instance.EnsureInTransaction(doc)
	#pipe = Autodesk.Revit.DB.Plumbing.Pipe.Create(doc,systemtype.Id,pipetype.Id,level[0].Id,FirstPoint[i].ToXyz(),SecondPoint[i].ToXyz())
#pipe = Autodesk.Revit.DB.Plumbing.PlumbingUtils.ConvertPipePlaceholders(doc, col1)

for i in range(0,len(pipes)-1):
	pipe = Autodesk.Revit.DB.Plumbing.PlumbingUtils.ConnectPipePlaceholders(doc, pipes[i].Id)
	elements.append(pipe)


#elements.append(pipe.ToDSType(False))

TransactionManager.Instance.TransactionTaskDone()

OUT = elements, pipes
# ----------------------------------------
code_block_7 = CodeBlock(a=pointAtParameter) { {a[0]}; }
code_block_8 = CodeBlock { {a[1]}; }  # unwired: a
select_model_elements_2 = DSModelElementsSelection()  # 1 picked in the model
code_block_9 = CodeBlock { "Type"; }
getParameterValueByName = Element.GetParameterValueByName(element=select_model_elements_2, parameterName=code_block_9)
code_block_10 = CodeBlock { "System Type"; }
getParameterValueByName_2 = Element.GetParameterValueByName(element=select_model_elements_2, parameterName=code_block_10)
levels = Levels("00")
python_script_3 = Python(IN[0]=code_block_8, IN[1]=getParameterValueByName, IN[2]=getParameterValueByName_2, IN[3]=levels)
# ---------- python_script_3.python (36 lines) ----------
import clr

clr.AddReference("RevitServices")
import RevitServices
from RevitServices.Persistence import DocumentManager
from RevitServices.Transactions import TransactionManager
doc = DocumentManager.Instance.CurrentDBDocument

clr.AddReference("RevitAPI")
import Autodesk
from Autodesk.Revit.DB import *

clr.AddReference("RevitNodes")
import Revit
clr.ImportExtensions(Revit.Elements)
clr.ImportExtensions(Revit.GeometryConversion)

toggle = ""

pts = IN[0]
pipetype = UnwrapElement(IN[1])
systemtype = UnwrapElement(IN[2])
level = UnwrapElement(IN[3])


elements = []

TransactionManager.Instance.EnsureInTransaction(doc)
for i in range(0,len(pts)):
	pipe = Autodesk.Revit.DB.Plumbing.Pipe.CreatePlaceholder(doc,systemtype.Id,pipetype.Id,level.Id,pts[i][0].ToXyz(),pts[i][1].ToXyz())
	elements.append(pipe.ToDSType(False))

TransactionManager.Instance.TransactionTaskDone()


OUT = elements
# ----------------------------------------
python_script_4 = Python(IN[0]=pointAtParameter, IN[1]=getParameterValueByName, IN[2]=getParameterValueByName_2, IN[3]=levels)  # same code as python_script_3
code_block_11 = CodeBlock { "System Type"; }
getParameterValueByName_3 = Element.GetParameterValueByName(element=python_script_4, parameterName=code_block_11)
code_block_12 = CodeBlock(a=getParameterValueByName_3) { a[0]; }
setParameterByName = Element.SetParameterByName(element=python_script_4, parameterName=code_block_11, value=code_block_12)
python_script_5 = Python(IN[0]=python_script_4)  # same code as python_script_3
code_block_13 = CodeBlock(a=python_script_4) { a[0]; }
python_script_6 = Python(IN[0]=code_block_13, IN[1]=getParameterValueByName_2)
# ---------- python_script_6.python (44 lines) ----------
import clr

clr.AddReference("RevitServices")
import RevitServices
from RevitServices.Persistence import DocumentManager
from RevitServices.Transactions import TransactionManager
doc = DocumentManager.Instance.CurrentDBDocument

clr.AddReference("RevitAPI")
import Autodesk
from Autodesk.Revit.DB import *

clr.AddReference("RevitNodes")
import Revit
clr.ImportExtensions(Revit.Elements)
clr.ImportExtensions(Revit.GeometryConversion)

toggle = ""

pl = IN[0]

systemtype = UnwrapElement(IN[1])



elements = []

TransactionManager.Instance.EnsureInTransaction(doc)
#for i in range(0,len(pts)):
	#pipe = Autodesk.Revit.DB.Plumbing.Pipe.CreatePlaceholder(doc,systemtype.Id,pipetype.Id,level.Id,pts[i][0].ToXyz(),pts[i][1].ToXyz())
	#elements.append(pipe.ToDSType(False))

#pipe = Autodesk.Revit.DB.Plumbing.PipingSystem.Create(doc, systemtype.Id, "ciao")

#pipe.Add(placeholders[0])
#elements.append(pipe.ToDSType(False))




TransactionManager.Instance.TransactionTaskDone()


OUT = elements
# ----------------------------------------
code_block_14 = CodeBlock { "MEPCurve"; }
getParameterValueByName_4 = Element.GetParameterValueByName(element=code_block_13, parameterName=code_block_14)
domain = Custom[Element.Domain](Element=code_block_13)  # Returns the domain of connectors on the element i.e. (domainHvac, domainPiping etc.)
python_script_7 = Python(IN[0]=code_block_13)
# ---------- python_script_7.python (41 lines) ----------
import clr
clr.AddReference('ProtoGeometry')
from Autodesk.DesignScript.Geometry import *

#The inputs to this node will be stored as a list in the IN variables.
if isinstance(IN[0],list):
	toggle = 0
	element = UnwrapElement(IN[0])
else:
	toggle = 1
	element = [UnwrapElement(IN[0])]

def getDomain(elem):
	try:
		connectors = elem.ConnectorManager.Connectors
	except:
		connectors = elem.MEPModel.ConnectorManager.Connectors
	
	if connectors.Size < 2:	
		for conn in connectors:
			connector = conn
			break
		return connector.Domain
	else:
		domain = []
		for conn in connectors:
			domain.append(conn.Domain)
		return domain

listout = []	
for x in element:
	try:
		domains = getDomain(x)
		listout.append(domains)
	except:
		listout.append(None)
#Assign your output to the OUT variable.
if toggle:
	OUT = domains
else:
	OUT = listout
# ----------------------------------------
