# Dynamo graph trussanalysis01.dyn (Dynamo 2.0.1.5055)

select_model_elements = DSModelElementsSelection()  # 53 picked in the model
getLocation = Element.GetLocation(element=select_model_elements)
python_script = Python(IN[0]=getLocation)
# ---------- python_script.python (31 lines) ----------
import clr

clr.AddReference('RevitAPI')
from Autodesk.Revit.DB import *
from Autodesk.Revit.DB.Structure import *

clr.AddReference('RevitAPIUI')
from Autodesk.Revit.UI import *

clr.AddReference('System')
from System.Collections.Generic import List

clr.AddReference('RevitNodes')
import Revit
clr.ImportExtensions(Revit.GeometryConversion)
clr.ImportExtensions(Revit.Elements)

clr.AddReference('RevitServices')
import RevitServices
from RevitServices.Persistence import DocumentManager
from RevitServices.Transactions import TransactionManager

doc = DocumentManager.Instance.CurrentDBDocument
uidoc=DocumentManager.Instance.CurrentUIApplication.ActiveUIDocument

#Preparing input from dynamo to revit
element = UnwrapElement(IN[0])



OUT = [e.GetType().Name for e in element]
# ----------------------------------------
uniqueItems = List.UniqueItems(list=python_script)
allIndicesOf = List.AllIndicesOf(list=python_script, item=uniqueItems)
getItemAtIndex = List.GetItemAtIndex(list=getLocation, index=allIndicesOf)
code_block = CodeBlock(a=getItemAtIndex) { a[2]; }
code_block_2 = CodeBlock(a=getItemAtIndex) { a[0]; }
ZAxis = Vector.ZAxis()
project = Point.Project(point=code_block, baseGeometry=code_block_2, projectionDirection=ZAxis, lacing=Longest)
select_model_elements_2 = DSModelElementsSelection()  # 1 picked in the model
code_block_3 = CodeBlock { ["Start Level Offset","End Level Offset"]; }
getParameterValueByName = Element.GetParameterValueByName(element=select_model_elements_2, parameterName=code_block_3)
byStartPointEndPointStartTangent = Arc.ByStartPointEndPointStartTangent()  # unwired: startPoint, endPoint, startTangent
getLocation_2 = Element.GetLocation(element=select_model_elements_2)
startPoint = Curve.StartPoint(curve=getLocation_2)
endPoint = Curve.EndPoint(curve=getLocation_2)
