# Dynamo graph updateFiles.dyn (Dynamo 2.1.0.6255)

# group: List of families in Revit
code_block = CodeBlock { DSCore.List.Flatten("file"+[1..20]); }

code_block_2 = CodeBlock { ["file4_DELETED","file9_DELETED","file1","file2","file7","file40","file45"]; }
code_block_3 = CodeBlock { "deleted"; }
code_block_4 = CodeBlock { 1; }
contains = String.Contains(str=code_block_2, searchFor=code_block_3, ignoreCase=code_block_4)
filterByBoolMask = List.FilterByBoolMask(list=code_block_2, mask=contains)

# group: toBeDeleted
python_script = Python(IN[0]=filterByBoolMask.in)
# ---------- python_script.python (3 lines) ----------
filesToDelete = IN[0]

OUT = [f[0:5] for f in filesToDelete]
# ----------------------------------------

allIndicesOf = List.AllIndicesOf(list=code_block, item=python_script)

# group: Delete these
getItemAtIndex = List.GetItemAtIndex(list=code_block, index=allIndicesOf)

allIndicesOf_2 = List.AllIndicesOf(list=code_block, item=filterByBoolMask.out)
clean = List.Clean(list=allIndicesOf_2@L1)

# group: update these
getItemAtIndex_2 = List.GetItemAtIndex(list=code_block, index=clean)

isEmpty = List.IsEmpty(list=allIndicesOf_2, lacing=Longest)
filterByBoolMask_2 = List.FilterByBoolMask(list=filterByBoolMask.out, mask=isEmpty)

# group: create these
code_block_5 = CodeBlock(a=filterByBoolMask_2.in) { a; }
