# Dynamo graph viewRange.dyn (Dynamo 1.3.2.2480)

views = Views("Wo - LEVEL 1 G.A. Coordination Plan")

# group: MEPover
view_viewrange_absolute = Custom[View.ViewRange absolute](view=views)  # Returns the 4 view range values relative in absolute Z values

# group: MEPover
view_viewrange_relative = Custom[View.ViewRange relative](View=views)  # Returns the 4 view range values relative to the view's level

python_script = Python(IN[0]=views)
# ---------- python_script.python (89 lines) ----------
import clr

clr.AddReference("RevitServices")
import RevitServices
from RevitServices.Persistence import DocumentManager
from RevitServices.Transactions import TransactionManager
doc = DocumentManager.Instance.CurrentDBDocument

clr.AddReference("RevitAPI")
import Autodesk
from Autodesk.Revit.DB import *

clr.AddReference("RevitNodes")
import Revit
clr.ImportExtensions(Revit.Elements)
clr.ImportExtensions(Revit.GeometryConversion)
#The inputs to this node will be stored as a list in the IN variables.
if isinstance(IN[0], list):
	views  = UnwrapElement(IN[0])
else:
	views = [UnwrapElement(IN[0])]

def getViewRange(view):
	if view.GetType() == Autodesk.Revit.DB.ViewPlan:
		viewrange = view.GetViewRange()
		try:
			cutId = viewrange.GetLevelId(PlanViewPlane.CutPlane)
			cutlevel = doc.GetElement(cutId)
			cut = viewrange.GetOffset(PlanViewPlane.CutPlane)
		except:
			cut = None
		
		try:
			topId = viewrange.GetLevelId(PlanViewPlane.TopClipPlane)
			toplevel = doc.GetElement(topId)
			topelev = toplevel.Elevation
			top = topelev + viewrange.GetOffset(PlanViewPlane.TopClipPlane)
			top -= cutlevel.Elevation
		except:
			top = None
			
		try:
			bottomId = viewrange.GetLevelId(PlanViewPlane.BottomClipPlane)
			bottomlevel = doc.GetElement(bottomId)
			bottomelev = bottomlevel.Elevation
			bottom = bottomelev + viewrange.GetOffset(PlanViewPlane.BottomClipPlane)
			bottom -= cutlevel.Elevation
		except:
			bottom = None
		
		try:
			depthId = viewrange.GetLevelId(PlanViewPlane.ViewDepthPlane)
			depthlevel = doc.GetElement(depthId)
			depthelev = depthlevel.Elevation
			depth = depthelev + viewrange.GetOffset(PlanViewPlane.ViewDepthPlane)
			depth -= cutlevel.Elevation
		except:
			depth = None

	return depth, bottom,cut,top, toplevel, cutlevel, bottomlevel, depthlevel

depth = []
bottom = []
cut = []
top = []
levels = []


getDocUnits = doc.GetUnits()
getDisplayUnits = getDocUnits.GetFormatOptions(UnitType.UT_Length).DisplayUnits


for view in views:
	try:
		depth.append(UnitUtils.ConvertFromInternalUnits(getViewRange(view)[0],getDisplayUnits))
		bottom.append(UnitUtils.ConvertFromInternalUnits(getViewRange(view)[1],getDisplayUnits))
		cut.append(UnitUtils.ConvertFromInternalUnits(getViewRange(view)[2],getDisplayUnits))
		top.append(UnitUtils.ConvertFromInternalUnits(getViewRange(view)[3],getDisplayUnits))
		levels.append([getViewRange(view)[4],getViewRange(view)[5],getViewRange(view)[6],getViewRange(view)[7]])
	except:
		depth.append(None)
		bottom.append(None)
		cut.append(None)
		top.append(None)
#Assign your output to the OUT variable.
if len(depth) == 1:
	OUT = top[0], cut[0], bottom[0], depth[0], levels[0]
else:
	OUT = top, cut, bottom, depth, levels
# ----------------------------------------
python_script_2 = Python(IN[0]=views)
# ---------- python_script_2.python (85 lines) ----------
import clr

clr.AddReference("RevitServices")
import RevitServices
from RevitServices.Persistence import DocumentManager
from RevitServices.Transactions import TransactionManager
doc = DocumentManager.Instance.CurrentDBDocument

clr.AddReference("RevitAPI")
import Autodesk
from Autodesk.Revit.DB import *

clr.AddReference("RevitNodes")
import Revit
clr.ImportExtensions(Revit.Elements)
clr.ImportExtensions(Revit.GeometryConversion)
#The inputs to this node will be stored as a list in the IN variables.
if isinstance(IN[0], list):
	views  = UnwrapElement(IN[0])
else:
	views = [UnwrapElement(IN[0])]

def getViewRange(view):
	if view.GetType() == Autodesk.Revit.DB.ViewPlan:
		viewrange = view.GetViewRange()
		try:
			cutId = viewrange.GetLevelId(PlanViewPlane.CutPlane)
			cutlevel = doc.GetElement(cutId)
			cut = cutlevel.Elevation + viewrange.GetOffset(PlanViewPlane.CutPlane)
		except:
			cut = None
		
		try:
			topId = viewrange.GetLevelId(PlanViewPlane.TopClipPlane)
			toplevel = doc.GetElement(topId)
			topelev = toplevel.Elevation
			top = topelev + viewrange.GetOffset(PlanViewPlane.TopClipPlane)
		except:
			top = None
			
		try:
			bottomId = viewrange.GetLevelId(PlanViewPlane.BottomClipPlane)
			bottomlevel = doc.GetElement(bottomId)
			bottomelev = bottomlevel.Elevation
			bottom = bottomelev + viewrange.GetOffset(PlanViewPlane.BottomClipPlane)
		except:
			bottom = None
		
		try:
			depthId = viewrange.GetLevelId(PlanViewPlane.ViewDepthPlane)
			depthlevel = doc.GetElement(depthId)
			depthelev = depthlevel.Elevation
			depth = depthelev + viewrange.GetOffset(PlanViewPlane.ViewDepthPlane)
		except:
			depth = None

	return depth, bottom,cut,top, toplevel, cutlevel, bottomlevel, depthlevel

depth = []
bottom = []
cut = []
top = []
levels = []

getDocUnits = doc.GetUnits()
getDisplayUnits = getDocUnits.GetFormatOptions(UnitType.UT_Length).DisplayUnits


for view in views:
	try:
		depth.append(UnitUtils.ConvertFromInternalUnits(getViewRange(view)[0],getDisplayUnits))
		bottom.append(UnitUtils.ConvertFromInternalUnits(getViewRange(view)[1],getDisplayUnits))
		cut.append(UnitUtils.ConvertFromInternalUnits(getViewRange(view)[2],getDisplayUnits))
		top.append(UnitUtils.ConvertFromInternalUnits(getViewRange(view)[3],getDisplayUnits))
		levels.append([getViewRange(view)[4],getViewRange(view)[5],getViewRange(view)[6],getViewRange(view)[7]])
	except:
		depth.append(None)
		bottom.append(None)
		cut.append(None)
		top.append(None)
#Assign your output to the OUT variable.
if len(depth) == 1:
	OUT = top[0], cut[0], bottom[0], depth[0], levels[0]
else:
	OUT = top, cut, bottom, depth, levels
# ----------------------------------------
code_block = CodeBlock(a=python_script_2) { a[4]; }
elevation = Level.Elevation(code_block)
sub = python_script_2 - elevation
