# Dynamo graph viewTemplate.dyn (Dynamo 1.3.1.1736)

# group: 1. Select all the views and isolate the View Templates
views = Custom[Document.Views]()  # Gets all views in the document - except for 3D view templates (as long as this bug is not fixed: https://github.com/DynamoDS/Dynamo/issues/2970)
isViewTemplate = Custom[View.IsViewTemplate](view=views)  # Checks if a given view is a view template
filterByBoolMask = List.FilterByBoolMask(list=views, mask=isViewTemplate)

# group: View Ids
python_script = Python(IN[0]=filterByBoolMask.out)
# ---------- python_script.python (24 lines) ----------
import clr
clr.AddReference('RevitAPI')
from Autodesk.Revit.DB import *

clr.AddReference("RevitServices")
import RevitServices
from RevitServices.Persistence import DocumentManager


doc = DocumentManager.Instance.CurrentDBDocument
views = UnwrapElement(IN[0])
elementlist = list()


views = UnwrapElement(IN[0])
template = []

for v in views:
	try:
		#template.append(doc.GetElement(v.ViewTemplateId))
		template.append(v.ViewTemplateId.ToString())
	except:
		""
OUT = template
# ----------------------------------------

name = Element.Name()  # unwired: arg0

# group: View Templates
sortByFunction = SortByFunction(filterByBoolMask.in, name)

id = Element.Id(sortByFunction)
string_from_object = FromObject(id)
allIndicesOf = List.AllIndicesOf(list=python_script, item=string_from_object)

# group: number of views per view template
count = Count(allIndicesOf, lacing=Longest)

# group: views per view template
getItemAtIndex = List.GetItemAtIndex(list=filterByBoolMask.out, index=allIndicesOf)

# group: view names
name_2 = Element.Name(getItemAtIndex)

code_block = CodeBlock(a=sortByFunction) { {a[10]}; }

# group: View Templates
python_script_2 = Python(IN[0]=code_block)
# ---------- python_script_2.python (25 lines) ----------
import clr
clr.AddReference('RevitAPI')
from Autodesk.Revit.DB import *

clr.AddReference("RevitServices")
import RevitServices
from RevitServices.Persistence import DocumentManager


doc = DocumentManager.Instance.CurrentDBDocument
views = UnwrapElement(IN[0])
elementlist = list()


views = UnwrapElement(IN[0])
template = []

for v in views:
	try:
		#template.append(doc.GetElement(v.ViewTemplateId))
		template.append(v.GetTemplateParameterIds())
	except:
		""

OUT = template
# ----------------------------------------

code_block_2 = CodeBlock(a=python_script_2) { a[0][26..30]; }
python_script_3 = Python(IN[0]=code_block_2)
# ---------- python_script_3.python (28 lines) ----------
import clr
clr.AddReference('ProtoGeometry')
from Autodesk.DesignScript.Geometry import *

clr.AddReference("RevitNodes")
import Revit
clr.ImportExtensions(Revit.Elements)

clr.AddReference("RevitServices")
import RevitServices
from RevitServices.Persistence import DocumentManager
from RevitServices.Transactions import TransactionManager

from System.Collections.Generic import *

clr.AddReference("RevitAPI")
import Autodesk
from Autodesk.Revit.DB import *

doc = DocumentManager.Instance.CurrentDBDocument

ids = IN[0]
elements = []

for i in ids:
		elements.append(doc.GetElement(i).ToDSType(True))

OUT = elements
# ----------------------------------------
name_3 = Element.Name(python_script_3)
code_block_3 = CodeBlock(a=python_script_2) { {a[0][20]}; }
python_script_4 = Python(IN[0]=code_block_3)
# ---------- python_script_4.python (28 lines) ----------
import clr
clr.AddReference('ProtoGeometry')
from Autodesk.DesignScript.Geometry import *

clr.AddReference("RevitNodes")
import Revit
clr.ImportExtensions(Revit.Elements)

clr.AddReference("RevitServices")
import RevitServices
from RevitServices.Persistence import DocumentManager
from RevitServices.Transactions import TransactionManager

from System.Collections.Generic import *

clr.AddReference("RevitAPI")
import Autodesk
from Autodesk.Revit.DB import *

doc = DocumentManager.Instance.CurrentDBDocument

ids = IN[0]
elements = []

for i in ids:
		elements.append(doc.GetElement(i))

OUT = elements
# ----------------------------------------

# group: view template names
name_4 = Element.Name(sortByFunction)

# group: Donor Template
code_block_4 = CodeBlock { "HideRvtLink"; }
indexOf = IndexOf(name_4, code_block_4)
getItemAtIndex_2 = List.GetItemAtIndex(list=filterByBoolMask.in, index=indexOf)

# group: Recipient Templates
code_block_5 = CodeBlock(a=getItemAtIndex) { a[6]; }
python_script_5 = Python(IN[0]=code_block_5)
# ---------- python_script_5.python (24 lines) ----------
import clr
clr.AddReference('RevitAPI')
from Autodesk.Revit.DB import *

clr.AddReference("RevitServices")
import RevitServices
from RevitServices.Persistence import DocumentManager


doc = DocumentManager.Instance.CurrentDBDocument
views = UnwrapElement(IN[0])
elementlist = list()


views = UnwrapElement(IN[0])
template = []

for v in views:
	try:
		#template.append(doc.GetElement(v.ViewTemplateId))
		template.append(doc.GetElement(v.ViewTemplateId))
	except:
		""
OUT = template
# ----------------------------------------
name_5 = Element.Name(code_block_5)

# group: ApplyViewTemplateParameters
python_script_6 = Python(IN[0]=getItemAtIndex_2, IN[1]=python_script_5)  # frozen
# ---------- python_script_6.python (41 lines) ----------
import clr
clr.AddReference('ProtoGeometry')
from Autodesk.DesignScript.Geometry import *

clr.AddReference("RevitNodes")
import Revit
clr.ImportExtensions(Revit.Elements)

clr.AddReference("RevitServices")
import RevitServices
from RevitServices.Persistence import DocumentManager
from RevitServices.Transactions import TransactionManager

from System.Collections.Generic import *

clr.AddReference("RevitAPI")
import Autodesk
from Autodesk.Revit.DB import *


doc = DocumentManager.Instance.CurrentDBDocument

donor = UnwrapElement(IN[0])

recipient = UnwrapElement(IN[1])

result = []

TransactionManager.Instance.EnsureInTransaction(doc)

for r in recipient:
	try:
		r.ApplyViewTemplateParameters(donor)
		result.append("done")
	except:
		result.append("fail")

TransactionManager.Instance.TransactionTaskDone()


OUT = result
# ----------------------------------------
