# Dynamo graph viewTypes.dyn (Dynamo 2.0.1.4955)

categories = Categories(index=587)
all_elements_of_category = ElementsOfCategory(Category=categories)
name = Element.Name(element=all_elements_of_category)
name_2 = Element.Name()  # unwired: element
file_path = Filename("C:\Users\giovanni.brogiolo\Desktop\Arup UKMEA Struc Template - 2017 Metric.rte")
openDocumentFile = Rhythm.Revit.Application.Application.OpenDocumentFile(filePath=file_path)
python_script = Python(IN[0]=openDocumentFile)
# ---------- python_script.python (84 lines) ----------
import clr

clr.AddReference('RevitAPI')
from Autodesk.Revit.DB import *
from Autodesk.Revit.DB.Structure import *

clr.AddReference('RevitAPIUI')
from Autodesk.Revit.UI import *

clr.AddReference('System')
from System.Collections.Generic import List

clr.AddReference('RevitNodes')
import Revit
clr.ImportExtensions(Revit.GeometryConversion)
clr.ImportExtensions(Revit.Elements)

clr.AddReference('RevitServices')
import RevitServices
from RevitServices.Persistence import DocumentManager
from RevitServices.Transactions import TransactionManager

doc = DocumentManager.Instance.CurrentDBDocument
uidoc=DocumentManager.Instance.CurrentUIApplication.ActiveUIDocument

#Preparing input from dynamo to revit
sourceDoc = UnwrapElement(IN[0])

#Do some action in a Transaction
TransactionManager.Instance.EnsureInTransaction(doc)

TransactionManager.Instance.TransactionTaskDone()

#   target document is the active document
targetDoc = doc
    
#    // element ids for all instances of the ViewFamilyType class
viewFamilyTypeIds = FilteredElementCollector(sourceDoc).OfClass(ViewFamilyType).ToElementIds();


#    // element ids of the view templates used in View Types
templateIds = []

#    // list of pairs of strings - first item in each pair will be the name of the View Type - second item will be the name of the View Template used by that View Type 
ssList = []



for vft in FilteredElementCollector(sourceDoc).OfClass(ViewFamilyType):
	# element id of the view template used in this View Type
	defaultTemplateId = vft.get_Parameter(BuiltInParameter.DEFAULT_VIEW_TEMPLATE).AsElementId();
    #go to the next View Type if there is no View Template assigned to this view type
	if (defaultTemplateId == ElementId.InvalidElementId):
		continue
        templateIds.append(defaultTemplateId);
        ssList.append([vft])
        #, sourceDoc.GetElement(defaultTemplateId).Name]);
    
"""
    CopyPasteOptions options = new CopyPasteOptions();

    using (Transaction t = new Transaction(targetDoc, "Copy View Types"))
    {
        t.Start();
        // copy the view templates
        ElementTransformUtils.CopyElements(sourceDoc, templateIds, targetDoc, Transform.Identity, options);
        // copy the view types
        ElementTransformUtils.CopyElements(sourceDoc, viewFamilyTypeIds, targetDoc, Transform.Identity, options);

        foreach (Tuple<string, string> tup in ssList)
        {
            Element vft = new FilteredElementCollector(targetDoc).OfClass(typeof(ViewFamilyType)).Where(q => q.Name == tup.Item1).FirstOrDefault();

            View template = new FilteredElementCollector(targetDoc).OfClass(typeof(View)).Cast<View>().Where(q => q.IsTemplate && q.Name == tup.Item2).FirstOrDefault();

            // assign the view template to the view type
            vft.get_Parameter(BuiltInParameter.DEFAULT_VIEW_TEMPLATE).Set(template.Id);
        }

        t.Commit();
    }
    """

OUT = ssList[0][0]
# ----------------------------------------
element_name_universal = Custom[Element Name Universal](Elements=python_script)  # Modified for 0.8.1
python_script_2 = Python(IN[0]=openDocumentFile)
# ---------- python_script_2.python (84 lines) ----------
import clr

clr.AddReference('RevitAPI')
from Autodesk.Revit.DB import *
from Autodesk.Revit.DB.Structure import *

clr.AddReference('RevitAPIUI')
from Autodesk.Revit.UI import *

#clr.AddReference('System')
#from System.Collections.Generic import List

clr.AddReference('RevitNodes')
import Revit
clr.ImportExtensions(Revit.GeometryConversion)
clr.ImportExtensions(Revit.Elements)

clr.AddReference('RevitServices')
import RevitServices
from RevitServices.Persistence import DocumentManager
from RevitServices.Transactions import TransactionManager

doc = DocumentManager.Instance.CurrentDBDocument
uidoc=DocumentManager.Instance.CurrentUIApplication.ActiveUIDocument

#Preparing input from dynamo to revit
sourceDoc = UnwrapElement(IN[0])

#Do some action in a Transaction
TransactionManager.Instance.EnsureInTransaction(doc)

TransactionManager.Instance.TransactionTaskDone()

#   target document is the active document
targetDoc = doc
    
#    // element ids for all instances of the ViewFamilyType class
viewFamilyTypeIds = FilteredElementCollector(sourceDoc).OfClass(ViewFamilyType).ToElementIds();


#    // element ids of the view templates used in View Types
templateIds = []

#    // list of pairs of strings - first item in each pair will be the name of the View Type - second item will be the name of the View Template used by that View Type 
ssList = []



for vft in FilteredElementCollector(sourceDoc).OfClass(ViewFamilyType):
	# element id of the view template used in this View Type
	defaultTemplateId = vft.get_Parameter(BuiltInParameter.DEFAULT_VIEW_TEMPLATE).AsElementId();
    #go to the next View Type if there is no View Template assigned to this view type
	if (defaultTemplateId == ElementId.InvalidElementId):
		continue
        templateIds.append(defaultTemplateId);
        ssList.append(vft.ToDSType(True).Name)
        #, sourceDoc.GetElement(defaultTemplateId).Name]);
    
"""
    CopyPasteOptions options = new CopyPasteOptions();

    using (Transaction t = new Transaction(targetDoc, "Copy View Types"))
    {
        t.Start();
        // copy the view templates
        ElementTransformUtils.CopyElements(sourceDoc, templateIds, targetDoc, Transform.Identity, options);
        // copy the view types
        ElementTransformUtils.CopyElements(sourceDoc, viewFamilyTypeIds, targetDoc, Transform.Identity, options);

        foreach (Tuple<string, string> tup in ssList)
        {
            Element vft = new FilteredElementCollector(targetDoc).OfClass(typeof(ViewFamilyType)).Where(q => q.Name == tup.Item1).FirstOrDefault();

            View template = new FilteredElementCollector(targetDoc).OfClass(typeof(View)).Cast<View>().Where(q => q.IsTemplate && q.Name == tup.Item2).FirstOrDefault();

            // assign the view template to the view type
            vft.get_Parameter(BuiltInParameter.DEFAULT_VIEW_TEMPLATE).Set(template.Id);
        }

        t.Commit();
    }
    """

OUT = ssList
# ----------------------------------------
python_script_3 = Python(IN[0]=python_script_2)
# ---------- python_script_3.python (22 lines) ----------
import clr
clr.AddReference('RevitAPI')
from Autodesk.Revit.DB import *

faminsts = IN[0]
elementlist = list()


for item in faminsts:
	try:
		n = UnwrapElement(item).Name
	except:
		n = None
	# Use a built-in property of (wrapped) Dynamo elements for family symbols instead
	if n == None:
		try:
			n = item.Name
		except:
			n = []
	elementlist.append(n)

OUT = elementlist
# ----------------------------------------
