# Dynamo graph voidByFace.dyn (Dynamo 2.1.0.5696)

# group: penetration family
family_types = FamilyTypes(index=1745)

# group: select the beams
select_model_elements = DSModelElementsSelection()  # 3 picked in the model

# group: Select the beam web face: Find the surface largest areas and pick one of the 2
faces = Element.Faces(element=select_model_elements)
area = Surface.Area(surface=faces)
maximumItem = List.MaximumItem(list=area)
allIndicesOf = List.AllIndicesOf(list=area, item=maximumItem, lacing=Longest)
getItemAtIndex = List.GetItemAtIndex(list=faces, index=allIndicesOf, lacing=Longest)

code_block = CodeBlock { 0; }
pointAtParameter = Surface.PointAtParameter(surface=getItemAtIndex, u=code_block, v=code_block)
location = StructuralFraming.Location(structuralFraming=select_model_elements)
direction = Line.Direction(line=location)
reverse = Vector.Reverse(vector=direction)
# note: 336 elements 3 minutes
byFace = FamilyInstance.ByFace(familyType=family_types, face=getItemAtIndex, location=pointAtParameter, referenceDirection=reverse)
setParameterByName = Element.SetParameterByName(element=byFace)  # unwired: parameterName, value
code_block_2 = CodeBlock { [1500]; }
pointAtSegmentLength = Curve.PointAtSegmentLength(curve=location, segmentLength=code_block_2, lacing=CrossProduct)

# group: select a group
select_model_element = DSModelElementSelection()  # nothing selected

# group: from clockwork
ungroup = Custom[Group.Ungroup](group=select_model_element)

# group: Clockwork
fromElements = Custom[Group.FromElements]()  # unwired: elements, groupName

python_script = Python()  # unwired: IN[0]
# ---------- python_script.python (26 lines) ----------
import clr
clr.AddReference('RevitAPI')
from Autodesk.Revit.DB import *
from System.Collections.Generic import *

clr.AddReference("RevitServices")
import RevitServices
from RevitServices.Persistence import DocumentManager
from RevitServices.Transactions import TransactionManager

doc = DocumentManager.Instance.CurrentDBDocument
groups = UnwrapElement(IN[0])
elementlist = list()
TransactionManager.Instance.EnsureInTransaction(doc)
for group in groups:
	try:
		ids = group.UngroupMembers()
		ungrouped = list()
		for id in ids:
			ungrouped.append(group.Document.GetElement(id))
		elementlist.append(ungrouped)
	except:
		elementlist.append(list())
TransactionManager.Instance.TransactionTaskDone()

OUT = elementlist
# ----------------------------------------
python_script_2 = Python()  # unwired: IN[0], IN[1]
# ---------- python_script_2.python (30 lines) ----------
import clr
clr.AddReference('RevitAPI')
from Autodesk.Revit.DB import *
from System.Collections.Generic import *

clr.AddReference("RevitServices")
import RevitServices
from RevitServices.Persistence import DocumentManager
from RevitServices.Transactions import TransactionManager

doc = DocumentManager.Instance.CurrentDBDocument
items = UnwrapElement(IN[0])
ids = list()
rejects = list()
for item in items:
	try:
		ids.append(item.Id)
	except:
		rejects.append(item)
items = List[ElementId](ids)

TransactionManager.Instance.EnsureInTransaction(doc)
try:
	group = doc.Create.NewGroup(items);
	group.GroupType.Name = IN[1]
except:
	group = list()
TransactionManager.Instance.TransactionTaskDone()

OUT = (group,rejects)
# ----------------------------------------
normalAtParameter = Surface.NormalAtParameter(surface=getItemAtIndex, u=code_block, v=code_block)
ZAxis = Vector.ZAxis()
cross = Vector.Cross(vector=normalAtParameter, cross=ZAxis)

# group: select the beams
select_model_elements_2 = DSModelElementsSelection()  # 1 picked in the model

# group: getgeomtrySymbol
python_script_3 = Python(IN[0]=select_model_elements_2, IN[1]=family_types)
# ---------- python_script_3.python (95 lines) ----------
import clr

clr.AddReference('RevitAPI')
from Autodesk.Revit.DB import *
from Autodesk.Revit.DB.Structure import *

clr.AddReference('RevitAPIUI')
from Autodesk.Revit.UI import *

clr.AddReference('System')
from System.Collections.Generic import List

clr.AddReference('RevitNodes')
import Revit
clr.ImportExtensions(Revit.GeometryConversion)
clr.ImportExtensions(Revit.Elements)

clr.AddReference('RevitServices')
import RevitServices
from RevitServices.Persistence import DocumentManager
from RevitServices.Transactions import TransactionManager

doc = DocumentManager.Instance.CurrentDBDocument
uidoc=DocumentManager.Instance.CurrentUIApplication.ActiveUIDocument

#Preparing input from dynamo to revit
beam = UnwrapElement(IN[0])

opt = Options()
opt.ComputeReferences = True
opt.IncludeNonVisibleObjects = False
opt.View = doc.ActiveView



geo = []
for obj in beam.get_Geometry(opt):
	if isinstance(obj, Solid):
		geo.append(obj)
		geo.append(obj.ConvertToMany())

geomInst = None;

instTransform = None;

for instance in beam.get_Geometry(opt):
	try:
		geomInst = instance.GetSymbolGeometry()
		instTransform = instance.Transform;
	except:
		continue

faces = []
geo = []

for solid in geomInst:
	faces.Add(solid.Faces)
	geo.append(solid.ConvertToMany())
	
	
areas = []
"""
for fa in faces:
	for f in fa:
		areas.append(f.Area)

webFace = faces[0][6]


bboxUV = webFace.GetBoundingBox()
center = (bboxUV.Max + bboxUV.Min) * 0.5;
start = bboxUV.Min;
location = webFace.Evaluate(start);

normal = webFace.ComputeNormal(center);
refDir = normal.CrossProduct(XYZ.BasisZ);

transformedPoint = instTransform.OfPoint(location);

tNormal = instTransform.OfPoint(normal);
transformedDir = instTransform.OfPoint(refDir);


direction = beam.Location.Curve.GetEndPoint(0) - beam.Location.Curve.GetEndPoint(1)

fs = UnwrapElement(IN[1])
#Do some action in a Transaction
TransactionManager.Instance.EnsureInTransaction(doc)

void = doc.Create.NewFamilyInstance.Overloads[Reference, XYZ, XYZ, FamilySymbol](webFace.Reference, transformedPoint, direction, fs);
#void = doc.Create.NewFamilyInstance(location,fs,normal,beam,StructuralType.NonStructural);

TransactionManager.Instance.TransactionTaskDone()
"""
OUT = geomInst
# ----------------------------------------

code_block_3 = CodeBlock(a=python_script_3) { a[2][0]; }
python_script_4 = Python(IN[0]=select_model_elements_2)
# ---------- python_script_4.python (33 lines) ----------
import clr

clr.AddReference('RevitAPI')
from Autodesk.Revit.DB import *
from Autodesk.Revit.DB.Structure import *

clr.AddReference('RevitAPIUI')
from Autodesk.Revit.UI import *

clr.AddReference('System')
from System.Collections.Generic import List

clr.AddReference('RevitNodes')
import Revit
clr.ImportExtensions(Revit.GeometryConversion)
clr.ImportExtensions(Revit.Elements)

clr.AddReference('RevitServices')
import RevitServices
from RevitServices.Persistence import DocumentManager
from RevitServices.Transactions import TransactionManager

doc = DocumentManager.Instance.CurrentDBDocument
uidoc=DocumentManager.Instance.CurrentUIApplication.ActiveUIDocument

#Preparing input from dynamo to revit
e = UnwrapElement(IN[0])

line = e.Location



OUT = line.Curve.Direction
# ----------------------------------------
python_script_5 = Python(IN[1]=family_types)  # unwired: IN[0]
# ---------- python_script_5.python (82 lines) ----------
import clr

clr.AddReference('RevitAPI')
from Autodesk.Revit.DB import *
from Autodesk.Revit.DB.Structure import *

clr.AddReference('RevitAPIUI')
from Autodesk.Revit.UI import *

clr.AddReference('System')
from System.Collections.Generic import List

clr.AddReference('RevitNodes')
import Revit
clr.ImportExtensions(Revit.GeometryConversion)
clr.ImportExtensions(Revit.Elements)

clr.AddReference('RevitServices')
import RevitServices
from RevitServices.Persistence import DocumentManager
from RevitServices.Transactions import TransactionManager

doc = DocumentManager.Instance.CurrentDBDocument
uidoc=DocumentManager.Instance.CurrentUIApplication.ActiveUIDocument

#Preparing input from dynamo to revit
beam = UnwrapElement(IN[0])

opt = Options()
opt.ComputeReferences = True
opt.IncludeNonVisibleObjects = False
opt.View = doc.ActiveView



geo = []
for obj in beam.get_Geometry(opt):
	if isinstance(obj, Solid):
		geo.append(obj)
		#geo.append(obj.ConvertToMany())

faces = []


for solid in geo:
	faces.Add(solid.Faces)
	
	
areas = []

for fa in faces:
	for f in fa:
		areas.append(f.Area)


webFace = faces[1][4]


bboxUV = webFace.GetBoundingBox()
center = (bboxUV.Max + bboxUV.Min) * 0.5;
start = bboxUV.Min;
location = webFace.Evaluate(start);

normal = webFace.ComputeNormal(center);
refDir = normal.CrossProduct(XYZ.BasisZ);

refDirBeam = beam.HandOrientation
origin = beam.GetTransform().Origin


direction = beam.Location.Curve.GetEndPoint(0) - beam.Location.Curve.GetEndPoint(1)

fs = UnwrapElement(IN[1])
#Do some action in a Transaction
TransactionManager.Instance.EnsureInTransaction(doc)

void = doc.Create.NewFamilyInstance.Overloads[Reference, XYZ, XYZ, FamilySymbol](webFace.Reference, location, direction, fs);
#void = doc.Create.NewFamilyInstance(location,fs,normal,beam,StructuralType.NonStructural);

TransactionManager.Instance.TransactionTaskDone()

OUT =  refDirBeam.ToVector(), origin.ToPoint()
# ----------------------------------------
deconstruct = List.Deconstruct(list=python_script_5)
code_block_4 = CodeBlock { 1000; }
byStartPointDirectionLength = Line.ByStartPointDirectionLength(startPoint=deconstruct.rest, direction=deconstruct.first, length=code_block_4)
byCurve = ModelCurve.ByCurve(curve=byStartPointDirectionLength)
python_script_6 = Python(IN[0]=select_model_elements_2, IN[1]=family_types)
# ---------- python_script_6.python (107 lines) ----------
import clr

clr.AddReference('RevitAPI')
from Autodesk.Revit.DB import *
from Autodesk.Revit.DB.Structure import *

clr.AddReference('RevitAPIUI')
from Autodesk.Revit.UI import *

clr.AddReference('System')
from System.Collections.Generic import List

clr.AddReference('RevitNodes')
import Revit
clr.ImportExtensions(Revit.GeometryConversion)
clr.ImportExtensions(Revit.Elements)

clr.AddReference('RevitServices')
import RevitServices
from RevitServices.Persistence import DocumentManager
from RevitServices.Transactions import TransactionManager

doc = DocumentManager.Instance.CurrentDBDocument
uidoc=DocumentManager.Instance.CurrentUIApplication.ActiveUIDocument

#Preparing input from dynamo to revit
beam = UnwrapElement(IN[0])

opt = Options()
opt.ComputeReferences = True
opt.IncludeNonVisibleObjects = False
opt.View = doc.ActiveView



geo = []
for obj in beam.get_Geometry(opt):
	if isinstance(obj, Solid):
		geo.append(obj)
		geo.append(obj.ConvertToMany())

geomInst = None;

instTransform = None;

for instance in beam.get_Geometry(opt):
	try:
		geomInst = instance.GetSymbolGeometry()
		instTransform = instance.Transform;
	except:
		continue

faces = []
geo = []

for solid in geomInst:
	faces.Add(solid.Faces)
	geo.append(solid.ConvertToMany())
	
	
areas = []
"""
for fa in faces:
	for f in fa:
		areas.append(f.Area)

webFace = faces[0][6]


bboxUV = webFace.GetBoundingBox()
center = (bboxUV.Max + bboxUV.Min) * 0.5;
start = bboxUV.Min;
location = webFace.Evaluate(start);

normal = webFace.ComputeNormal(center);
refDir = normal.CrossProduct(XYZ.BasisZ);

transformedPoint = instTransform.OfPoint(location);

tNormal = instTransform.OfPoint(normal);
transformedDir = instTransform.OfPoint(refDir);


direction = beam.Location.Curve.GetEndPoint(0) - beam.Location.Curve.GetEndPoint(1)

fs = UnwrapElement(IN[1])
#Do some action in a Transaction
TransactionManager.Instance.EnsureInTransaction(doc)

void = doc.Create.NewFamilyInstance.Overloads[Reference, XYZ, XYZ, FamilySymbol](webFace.Reference, transformedPoint, direction, fs);
#void = doc.Create.NewFamilyInstance(location,fs,normal,beam,StructuralType.NonStructural);

TransactionManager.Instance.TransactionTaskDone()
"""
instance = beam.get_Geometry(opt)


geomInstance = None;


for i in instance:
	if isinstance(i, Solid):
		continue
	else:
		geomInstance = i
		
OUT = geomInstance.Symbol
# ----------------------------------------
