# Dynamo graph wallByLine.dyn (Dynamo 2.0.1.4955)

select_model_elements = DSModelElementsSelection()  # 14 picked in the model
geometry = Element.Geometry(element=select_model_elements)
explode = Geometry.Explode(geometry=geometry)
flatten = List.Flatten(list=explode)
startPoint = Curve.StartPoint(curve=flatten)
endPoint = Curve.EndPoint(curve=flatten)
byStartPointEndPoint = Line.ByStartPointEndPoint(startPoint=startPoint, endPoint=endPoint)
code_block = CodeBlock { 1800; }
levels = Levels(index=1)
wall_types = WallTypes(index=6)
byCurveAndHeight = Wall.ByCurveAndHeight(curve=byStartPointEndPoint, height=code_block, level=levels, wallType=wall_types)
