# Dynamo graph workspace.dyn (Dynamo 2.0.1.5055)

python_script = Python()  # unwired: IN[0]
# ---------- python_script.python (23 lines) ----------
import clr
import datetime
clr.AddReference('ProtoGeometry')
from Autodesk.DesignScript.Geometry import *

clr.AddReference('DynamoRevitDS')
import Dynamo
#access to the current Dynamo instance and workspace
dynamoRevit = Dynamo.Applications.DynamoRevit()
currentWorkspace = dynamoRevit.RevitDynamoModel.CurrentWorkspace

#custom definition to mark the node as changed

def nodesAdded(obj):
    for i in currentWorkspace.Nodes:
        if i.NickName.StartsWith("*Force"):
            i.MarkNodeAsModified(True)
#the handlers for a node being added or removed
currentWorkspace.NodeAdded += nodesAdded
currentWorkspace.NodeRemoved += nodesAdded

#usind the current time for the output as an example
OUT = currentWorkspace
# ----------------------------------------
