# Dynamo graph 3-SetElementOjectId - Copy.dyn (Dynamo 2.0.2.6826)

python_script = Python()
# ---------- python_script.python (59 lines) ----------
import clr
# Import RevitAPI
clr.AddReference("RevitAPI")
from Autodesk.Revit.DB import *
clr.AddReference("RevitAPIUI")
from Autodesk.Revit.UI import TaskDialog
# Import DocumentManager and TransactionManager
clr.AddReference("RevitServices")
from RevitServices.Persistence import DocumentManager
from RevitServices.Transactions import TransactionManager
# Import ToProtoType, ToRevitType geometry conversion extension methods
clr.AddReference("RevitNodes")
import Revit
clr.ImportExtensions(Revit.Elements)
clr.ImportExtensions(Revit.GeometryConversion)
from System.Collections.Generic import *
import System

doc = DocumentManager.Instance.CurrentDBDocument
uiapp = DocumentManager.Instance.CurrentUIApplication
app = uiapp.Application




collector = FilteredElementCollector( doc ).WhereElementIsNotElementType()

cat = []

for c in collector:
	if (None != c.Category and c.Category.HasMaterialQuantities):
		cat.append(c)


category = [c.Category.Name for c in cat]


uniqueCategory = list(set(category))


#typeIds = [c.GetTypeId() for c in cat]
#unique = list(set(typeIds))

indexes = []

f = lambda my_list, value:filter(lambda x: my_list[x] == value, range(len(my_list)))

for x in uniqueCategory:
	indexes.append(f(category, x))

result = []

for i in indexes:
	sub = []
	result.append(sub)
	for j in i:
		sub.append(cat[j])

OUT = result, [r[0].GetType().Name for r in result], indexes, uniqueCategory
# ----------------------------------------
code_block = CodeBlock(a=python_script) { a[0]; }
code_block_2 = CodeBlock { 1; }
removeItemAtIndex = List.RemoveItemAtIndex(list=code_block, indices=code_block_2)
type = archilab.Revit.Elements.Elements.Type()  # unwired: element
groupByFunction = List.GroupByFunction(list=removeItemAtIndex, func=type, lacing=Longest)
flatten = List.Flatten(list=groupByFunction)
code_block_3 = CodeBlock { "1"; }
count = List.Count(list=groupByFunction@L2, lacing=Longest)
code_block_4 = CodeBlock(a=count) { 1..a; }
string_from_object = FromObject(obj=code_block_4)
code_block_5 = CodeBlock { 5; }
code_block_6 = CodeBlock { "0"; }
padLeft = String.PadLeft(str=string_from_object, newWidth=code_block_5, padChars=code_block_6)
code_block_7 = CodeBlock(a=code_block_3, b=padLeft) { a+b; }
flatten_2 = List.Flatten(list=code_block_7)
boolean = BoolSelector(true)  # graph input
python_script_2 = Python(IN[0]=flatten, IN[1]=flatten_2, IN[2]=boolean)
# ---------- python_script_2.python (49 lines) ----------
import clr
# Import RevitAPI
clr.AddReference("RevitAPI")
from Autodesk.Revit.DB import *
clr.AddReference("RevitAPIUI")
from Autodesk.Revit.UI import TaskDialog
# Import DocumentManager and TransactionManager
clr.AddReference("RevitServices")
from RevitServices.Persistence import DocumentManager
from RevitServices.Transactions import TransactionManager
# Import ToProtoType, ToRevitType geometry conversion extension methods
clr.AddReference("RevitNodes")
import Revit
clr.ImportExtensions(Revit.Elements)
clr.ImportExtensions(Revit.GeometryConversion)
from System.Collections.Generic import *
import System

doc = DocumentManager.Instance.CurrentDBDocument
uiapp = DocumentManager.Instance.CurrentUIApplication
app = uiapp.Application



elements = UnwrapElement(IN[0])

locCode = IN[1]


model_cat = []
error = []

count = 0
total = 0

if IN[2] == True:
	TransactionManager.Instance.EnsureInTransaction(doc)
	for i in range(0,len(elements)):
		for j in range(0,len(elements[i])):
			total +=1
			locationCode = elements[i][j].LookupParameter("Object ID Number")
			locationCode.Set(locCode[i][j])
			count +=1
	TransactionManager.Instance.TransactionTaskDone()
	OUT  = str(count)+"/"+str(total)+" modified", error
else:
	OUT = "Set true to run"

#OUT = model_cat, [c.Name for c in model_cat], elements
# ----------------------------------------

# group: Element Types not modified
code_block_8 = CodeBlock(a=python_script_2) { a[1]; }
name = Element.Name(element=code_block_8)

# group: Category Checker
select_model_element = DSModelElementSelection()  # nothing selected; graph input
python_script_3 = Python(IN[0]=select_model_element)
# ---------- python_script_3.python (50 lines) ----------
import clr
# Import RevitAPI
clr.AddReference("RevitAPI")
from Autodesk.Revit.DB import *
clr.AddReference("RevitAPIUI")
from Autodesk.Revit.UI import TaskDialog
# Import DocumentManager and TransactionManager
clr.AddReference("RevitServices")
from RevitServices.Persistence import DocumentManager
from RevitServices.Transactions import TransactionManager
# Import ToProtoType, ToRevitType geometry conversion extension methods
clr.AddReference("RevitNodes")
import Revit
clr.ImportExtensions(Revit.Elements)
clr.ImportExtensions(Revit.GeometryConversion)
from System.Collections.Generic import *
import System

doc = DocumentManager.Instance.CurrentDBDocument
uiapp = DocumentManager.Instance.CurrentUIApplication
app = uiapp.Application

categories = doc.Settings.Categories;

bics = System.Enum.GetValues(BuiltInCategory)

elements = [UnwrapElement(IN[0])]

# Element Type Id of elements
id = [ e.GetTypeId() for e in elements]

#eid = []

# Unique Type Ids
uniqueTypesIds = list(set(id))

type = []

for i in uniqueTypesIds:
	try:
		eleType = doc.GetElement( i )
		if eleType != None:
			type.append(eleType.Category.Name)
#			eid.append(eleType.Name)
	except:
		continue

OUT = type
#OUT = model_cat, [c.Name for c in model_cat], elements
#OUT  = type, model_cat, builtInCats, elements, eid, uniqueTypesIds
# ----------------------------------------

# group: Unique Categories
code_block_9 = CodeBlock(a=python_script) { a[3]; }
