# Dynamo graph 3dView.dyn (Dynamo 1.3.4.6666)

current = Document.Current()
activeView = Document.ActiveView(current)
getCropBox = Rhythm.Revit.Views.ViewPlan.GetCropBox(activeView)
element_create_3d_cropped_view = Custom[Element.Create 3D Cropped view]()  # create 3d view for each element and crop view; unwired: element, Offset, Refresh_bool
views = Views("{3D}")
views_2 = Views("Section 1")
getCropBoxCurves = Custom[View.GetCropBoxCurves](Views=views_2)  # returns the curves of a view crop box, even irregular shapes. Returns an empty list if the crop view is not active for a given view
byJoinedCurves = PolyCurve.ByJoinedCurves(getCropBoxCurves)
boundingBox = Geometry.BoundingBox(byJoinedCurves)
minPoint = BoundingBox.MinPoint(boundingBox)
code_block = CodeBlock(a=minPoint) { Autodesk.Point.ByCoordinates(a.X,a.Y,-1000); }
maxPoint = BoundingBox.MaxPoint(boundingBox)
code_block_2 = CodeBlock(a=maxPoint) { Autodesk.Point.ByCoordinates(a.X,a.Y,1000); }
byCorners = BoundingBox.ByCorners(min=code_block, max=code_block_2)
setSectionBox = Rhythm.Revit.Views.View3D.SetSectionBox(views, byCorners)
code_block_3 = CodeBlock { {-1000,1000}; }
