# Dynamo graph LevelName_BuiltInParameter.dyn (Dynamo 1.0.0.1180)

select_model_elements = DSModelElementsSelection()  # 40 picked in the model
create = List.Create(select_model_elements)
flatten = Flatten(create)
level_name = Python(IN[0]=select_model_elements)
# ---------- level_name.python (40 lines) ----------
#Starter pack by Julien Benoit @jbenoit44 
import clr
clr.AddReference('ProtoGeometry')
from Autodesk.DesignScript.Geometry import *
# Import ToDSType(bool) extension method
clr.AddReference("RevitNodes")
import Revit
clr.ImportExtensions(Revit.Elements)
# Import geometry conversion extension methods
clr.ImportExtensions(Revit.GeometryConversion)
# Import DocumentManager and TransactionManager
clr.AddReference("RevitServices")
import RevitServices
from RevitServices.Persistence import DocumentManager
from RevitServices.Transactions import TransactionManager
from System.Collections.Generic import *
# Import RevitAPI
clr.AddReference("RevitAPI")
import Autodesk
from Autodesk.Revit.DB import *

doc = DocumentManager.Instance.CurrentDBDocument
uiapp = DocumentManager.Instance.CurrentUIApplication
app = uiapp.Application
uidoc=DocumentManager.Instance.CurrentUIApplication.ActiveUIDocument
#End of starter pack by Julien Benoit @jbenoit44 

ele = UnwrapElement(IN[0])
para = []

TransactionManager.Instance.EnsureInTransaction(doc)
for i in ele:
	try:
		para.append(i.get_Parameter(BuiltInParameter.FAMILY_LEVEL_PARAM).AsValueString())
	except:
		para.append(i.get_Parameter(BuiltInParameter.RBS_START_LEVEL_PARAM).AsValueString())
		
TransactionManager.Instance.TransactionTaskDone()

OUT = para
# ----------------------------------------
