# Dynamo custom node JBE sheet views.dyf (Dynamo 0.6.3.22045)
# category: Core.Lists

Views = Input()
length = Length(Views)
number = DoubleInput(1)
lt = LessThan(length, number)
empty = Empty()
names = Input()
split_list = DeCons(names)
numbers = Input()
split_list_2 = DeCons(numbers)
Title_block = Input()
split_list_3 = DeCons(Views)
turn_into_list = Custom[Turn Into List](item=split_list_3.out0)  # Turns an element into a (flat) list
view_sheet = ViewSheet(split_list.out0, split_list_2.out0, Title_block, turn_into_list, lacing=Longest)
turn_into_list_2 = Custom[Turn Into List](item=split_list_3.out1)
jbe_sheet_views = Custom[JBE sheet views](names=split_list.out1, numbers=split_list_2.out1, Title_block=Title_block, Views=turn_into_list_2)
list = NewList(index0=view_sheet, index1=jbe_sheet_views)
if_ = Conditional(lt, empty, list)
Output = Output(if_)  # ""
