# Dynamo custom node Loop While.dyf (Dynamo 0.7.2.19521)
# category: Core.Evaluate
# Loops until a condition for a state is met, updating the state on each iteration.
# Takes an initital value, a function to produce a new value, and a function that determines whether to keep looping.
# In effect, produces the following while loop:
# while(continueWhile(init))
#     init = body(init);
# return init;

body = Input()
continueWhile = Input()
init = Input()
code_block = CodeBlock(body, continueWhile, init)
# ---------- code_block.designscript (10 lines) ----------
body;
continueWhile;
a = [Imperative]
{
    while (__Apply(continueWhile, init))
    {
        init = __Apply(body, init);
    }
    return = init;
};
# ----------------------------------------
result = Output(code_block.out2)
