# Dynamo custom node LunchBox Floor Element Collector.dyf (Dynamo 0.8.1.1942)
# category: LunchBox.Revit.Elements
# Collects Floor elements from the current Revit document.

Toggle = Input()
Floor_Type = Input()
python_script = Python(IN[0]=Toggle, IN[1]=Floor_Type)
# ---------- python_script.python (124 lines) ----------
#Copyright(c) 2014, Nathan Miller
# The Proving Ground, http://theprovingground.org
import clr

# Import RevitAPI
clr.AddReference("RevitAPI")
import Autodesk
from Autodesk.Revit.DB import *

# Import DocumentManager and TransactionManager
clr.AddReference("RevitServices")
import RevitServices
from RevitServices.Persistence import DocumentManager
from RevitServices.Transactions import TransactionManager

# Import ToDSType(bool) extension method
clr.AddReference("RevitNodes")
import Revit
clr.ImportExtensions(Revit.Elements)

#The input to this node will be stored in the IN[0] variable.

doc =  DocumentManager.Instance.CurrentDBDocument
app =  DocumentManager.Instance.CurrentUIApplication.Application

toggle = IN[0]
floortype = IN[1]

output = []
floors = []
levels = []
areas = []
boundaries = []
locations = []
elementids = []
uniqueids = []

if toggle == True:
	collector = FilteredElementCollector(doc)
	collector.OfClass(Floor)
 
	famtypeitr = collector.GetElementIdIterator()
	famtypeitr.Reset()

	for item in famtypeitr:
		famtypeID = item
		faminst = doc.GetElement(famtypeID)
		if floortype == '*':
			floor = faminst
			for p in floor.Parameters:
				if p.Definition.Name == 'Level':		
					level = p.AsValueString()
				if p.Definition.Name == 'Area':		
					area = p.AsDouble

			elementid = faminst.Id.ToString()
			uniqueid = faminst.UniqueId
    	
			boptions = app.Create.NewGeometryOptions()
			floorgeo = floor.get_Geometry(boptions)
			faces = []
			for geo in floorgeo:
				instance = geo		
				solidface = instance.Faces
				for face in solidface:
					faces.append(face)
    
			edgeloops = faces[1].EdgeLoops
			edges = []
			for loop in edgeloops:
				edgs = []
				for edge in loop:
					edgs.append(Revit.GeometryConversion.RevitToProtoCurve.ToProtoType( edge.AsCurve(), True ))
				edges.append(edgs)
    	
			floors.append(floor)
			boundaries.append(edges)
			levels.append(level)
			areas.append(area)
			elementids.append(elementid)
			uniqueids.append(uniqueid)    
		elif faminst.FloorType.Id == UnwrapElement(floortype).Id:
			floor = faminst
			for p in floor.Parameters:
				if p.Definition.Name == 'Level':		
					level = p.AsValueString()
				if p.Definition.Name == 'Area':		
					area = p.AsDouble
			elementid = faminst.Id.ToString()
			uniqueid = faminst.UniqueId
    	
			boptions = app.Create.NewGeometryOptions()
			floorgeo = floor.get_Geometry(boptions)
			faces = []
			for geo in floorgeo:
				instance = geo		
				solidface = instance.Faces
				for face in solidface:
					faces.append(face)
    
			edgeloops = faces[1].EdgeLoops
			edges = []
			for loop in edgeloops:
				edgs = []
				for edge in loop:
					edgs.append(Revit.GeometryConversion.RevitToProtoCurve.ToProtoType( edge.AsCurve(), True ))
				edges.append(edgs)
    	
			floors.append(floor)
			boundaries.append(edges)
			levels.append(level)
			areas.append(area)
			elementids.append(elementid)
			uniqueids.append(uniqueid)
        
	output.append(floors)
	output.append(boundaries)
	output.append(levels)
	output.append(areas)
	output.append(elementids)
	output.append(uniqueids)
        
#Assign your output to the OUT variable
OUT = output
# ----------------------------------------
number = DoubleInput(0)
getItemAtIndex = List.GetItemAtIndex(list=python_script, index=number)
Floor_Element = Output(getItemAtIndex)
solids = Element.Solids(getItemAtIndex, lacing=Longest)
Solid = Output(solids)
number_2 = DoubleInput(1)
getItemAtIndex_2 = List.GetItemAtIndex(list=python_script, index=number_2)
Floor_Boundary = Output(getItemAtIndex_2)
number_3 = DoubleInput(2)
getItemAtIndex_3 = List.GetItemAtIndex(list=python_script, index=number_3)
Level = Output(getItemAtIndex_3)
number_4 = DoubleInput(3)
getItemAtIndex_4 = List.GetItemAtIndex(list=python_script, index=number_4)
Area = Output(getItemAtIndex_4)
number_5 = DoubleInput(4)
getItemAtIndex_5 = List.GetItemAtIndex(list=python_script, index=number_5)
Element_ID = Output(getItemAtIndex_5)
number_6 = DoubleInput(5)
getItemAtIndex_6 = List.GetItemAtIndex(list=python_script, index=number_6)
Unique_ID = Output(getItemAtIndex_6)
