# Dynamo graph ExcelReadNodes.dyn (Dynamo 0.8.2.2392)

file_path = Filename("C:\Users\archinate\Dropbox\PROVING GROUND LLC\Curriculum\Dynamo for Architects\Dataset\Part 1 - Data Structures\2 - Data Exporting\WS-ExportedRooms.xlsx")
boolean = BoolSelector(false)
string = StringInput("Rooms")
getExcelWorksheetData = Interoperability.Excel.GetExcelWorksheetData(file_path, boolean, string)
# note: SELECT format..... [Column Name] = 'String'
string_2 = StringInput("[3] = '01 - Entry Level'")
selectDataFromTable = Lists.DataSets.SelectDataFromTable(getExcelWorksheetData, string_2)
getDataFromTable = Lists.DataSets.GetDataFromTable(selectDataFromTable.out0)
watch = Watch(getDataFromTable)
getDataFromTable_2 = Lists.DataSets.GetDataFromTable(getExcelWorksheetData)
watch_2 = Watch(selectDataFromTable.out1)
getExcelWorksheetDataByRange = Interoperability.Excel.GetExcelWorksheetDataByRange()
getExcelFileInfo = Interoperability.Excel.GetExcelFileInfo(file_path)
