# Dynamo graph LB_Helicoid.dyn (Dynamo 0.7.4.3245)

number = DoubleInput(50)
number_2 = DoubleInput(50)
double_slider = DoubleSlider(2, range=0..5)
double_slider_2 = DoubleSlider(1, range=0..5)
double_slider_3 = DoubleSlider(5, range=0..5)
double_slider_4 = DoubleSlider(4, range=0..4)
number_3 = DoubleInput(-1)
mul = double_slider_4 * number_3
double_slider_5 = DoubleSlider(4, range=0..7)
number_4 = DoubleInput(-1)
mul_2 = double_slider_5 * number_4
lunchbox_helicoid = Custom[LunchBox Helicoid](U=number, V=number_2, R=double_slider, T=double_slider_2, S=double_slider_3, U0=mul, U1=double_slider_4, V0=mul_2, V1=double_slider_5)  # Creates a parametric Helicoid surface
