# Dynamo graph LB_Mobius.dyn (Dynamo 0.7.4.3245)

number = DoubleInput(100)
number_2 = DoubleInput(50)
double_slider = DoubleSlider(3, range=0..5)
integer_slider = IntegerSlider(1, range=0..5)
double_slider_2 = DoubleSlider(8, range=0..8)
PI = Math.PI()
number_3 = DoubleInput(-1)
mul = PI * number_3
double_slider_3 = DoubleSlider(0.095, range=0..1)
mul_2 = mul * double_slider_3
mul_3 = PI * double_slider_3
number_4 = DoubleInput(1)
lunchbox_mobius = Custom[LunchBox Mobius](U=number, V=number_2, R=double_slider, T=integer_slider, S=double_slider_2, U0=mul_2, U1=mul_3, V0=number_3, V1=number_4)  # Creates a parametric mobius surface.
