# Dynamo graph LB_Paraboloid.dyn (Dynamo 0.7.4.3245)

number = DoubleInput(50)
number_2 = DoubleInput(50)
double_slider = DoubleSlider(2, range=0..5)
double_slider_2 = DoubleSlider(2, range=0..5)
double_slider_3 = DoubleSlider(5, range=0..5)
number_3 = DoubleInput(4)
number_4 = DoubleInput(-1)
mul = number_3 * number_4
number_5 = DoubleInput(4)
number_6 = DoubleInput(-1)
mul_2 = number_5 * number_6
lunchbox_paraboloid = Custom[LunchBox Paraboloid](U=number, V=number_2, A=double_slider, B=double_slider_2, S=double_slider_3, U0=mul, U1=number_3, V0=mul_2, V1=number_5)  # Creates a parametric Hyperbolic Paraboloid surface
