# Dynamo graph LB_Torus.dyn (Dynamo 0.7.4.3245)

number = DoubleInput(100)
number_2 = DoubleInput(96)
double_slider = DoubleSlider(4, range=0..5)
double_slider_2 = DoubleSlider(2, range=0..5)
double_slider_3 = DoubleSlider(1, range=0..5)
double_slider_4 = DoubleSlider(5, range=0..5)
number_3 = DoubleInput(0.001)
PI = Math.PI()
number_4 = DoubleInput(2)
mul = PI * number_4
PI_2 = Math.PI()
number_5 = DoubleInput(-1)
mul_2 = PI_2 * number_5
lunchbox_torus = Custom[LunchBox Torus](U=number, V=number_2, C=double_slider, R=double_slider_2, T=double_slider_3, S=double_slider_4, U0=number_3, U1=mul, V0=mul_2, V1=PI_2)  # Creates a parametric Torus surface
