# Dynamo graph LB_Wave_2.dyn (Dynamo 0.7.6.3557)

number = DoubleInput(50)
number_2 = DoubleInput(50)
double_slider = DoubleSlider(0.25, range=0..1 step 0.01)
double_slider_2 = DoubleSlider(2, range=0..5 step 0.01)
double_slider_3 = DoubleSlider(10, range=0..10 step 0.01)
number_3 = DoubleInput(0)
number_4 = DoubleInput(8)
number_5 = DoubleInput(0)
number_6 = DoubleInput(8)
lunchbox_wave = Custom[LunchBox Wave](U=number, V=number_2, A=double_slider, B=double_slider_2, S=double_slider_3, U0=number_3, U1=number_4, V0=number_5, V1=number_6)  # Creates a parametric Wave surface
integer_slider = IntegerSlider(10, range=0..10 step 1)
integer_slider_2 = IntegerSlider(10, range=0..10 step 1)
lunchbox_diamond_grid_by_face = Custom[LunchBox Diamond Grid by Face](U=integer_slider, V=integer_slider_2)  # Create a Diamond XYZ grid on a face. The face surface must have an untrimmed UV parameter space.
