# Dynamo custom node Loop Completion Check.dyf (Dynamo 0.7.4.3192)
# category: Optimo.Optimo.NSGA_II.Actions
# A function that checcks if the loop is completed

init = Input()
firstItem = List.FirstItem(init)
Iteration_Number = Input()
lt = firstItem < Iteration_Number
Continue = Output(lt)  # "Continue?"
