# Dynamo custom node NSGA_II Function-Point on Surface.dyf (Dynamo 0.7.4.3192)
# category: Optimo.Optimo
# The function that does the generation for NSGA_II.

init = Input()
code_block = CodeBlock(lst=init) { lst[0]; lst[1]; }
code_block_2 = CodeBlock(a=code_block.out0) { a+1; }
loweLomits = Input()
upperLimits = Input()
generationAlgorithm = Optimo.NSGA_II.GenerationAlgorithm(code_block.out1, loweLomits, upperLimits)
code_block_3 = CodeBlock(pop=generationAlgorithm) { pop[0]; }
code_block_4 = CodeBlock(pop=generationAlgorithm) { pop[1]; }
code_block_5 = CodeBlock(x=code_block_3, y=code_block_4) { Point.ByCoordinates(x,y,0); }
ZAxis = Vector.ZAxis()
code_block_6 = CodeBlock { 200; }
byStartPointDirectionLength = Line.ByStartPointDirectionLength(code_block_5, ZAxis, code_block_6)
# note: You can replace these two function with your own fitness functions for optimization.
# Please see https://github.com/mrahmaniasl/Optimo/wiki/Setup-Dynamo-Code-for-Optimo for more information.
select_face = DSFaceSelection()  # 1 picked in the model
intersect = Geometry.Intersect(byStartPointDirectionLength, select_face, lacing=Longest)
code_block_7 = CodeBlock(intersect) { P.Z; }
code_block_8 = CodeBlock { 1; }
flatten = List.Flatten(code_block_7, code_block_8)
create = List.Create(flatten)
assignFitnessFuncResults = Optimo.NSGA_II.AssignFitnessFuncResults(generationAlgorithm, create)
sorting = Optimo.NSGA_II.Sorting(code_block.out1, assignFitnessFuncResults, loweLomits, upperLimits)
create_2 = List.Create(code_block_2, sorting)
Results = Output(create_2)
watch = Watch(code_block.out1)
