# Dynamo custom node NSGA_II Function-SCH.dyf (Dynamo 0.7.4.3192)
# category: Optimo.Optimo
# The function that does the generation for NSGA_II.

init = Input()
code_block = CodeBlock(lst=init) { lst[0]; lst[1]; }
code_block_2 = CodeBlock(a=code_block.out0) { a+1; }
loweLomits = Input()
upperLimits = Input()
generationAlgorithm = Optimo.NSGA_II.GenerationAlgorithm(code_block.out1, loweLomits, upperLimits)
code_block_3 = CodeBlock(pop=generationAlgorithm) { pop[0]; }
f1 = CodeBlock(X=code_block_3) { Math.Pow(X,2); }
f2 = CodeBlock(X=code_block_3) { Math.Pow(X-2,2); }
create = List.Create(f1, f2)
assignFitnessFuncResults = Optimo.NSGA_II.AssignFitnessFuncResults(generationAlgorithm, create)
sorting = Optimo.NSGA_II.Sorting(code_block.out1, assignFitnessFuncResults, loweLomits, upperLimits)
create_2 = List.Create(code_block_2, sorting)
Results = Output(create_2)
watch = Watch(code_block.out0)
