# Dynamo graph Optimization Example-01-Point on Surface.dyn (Dynamo 0.7.4.3192)

file_path = Filename("C:\Users\t_aslm\Desktop\gbXML\MOO Minimum Point.csv")
code_block = CodeBlock { 1; }
population_size = CodeBlock { 100; }
number_of_objectives = CodeBlock { 1; }
lower_limits = CodeBlock { 0; }
# note: The number of items in lower limit and upper limit lists must be the equal. This number is used as number of variables.
lower_limits_list = List.Create(lower_limits, lower_limits)
upper_limits = CodeBlock { 90; }
upper_limit_list = List.Create(upper_limits, upper_limits)
initialSolutionList = Optimo.NSGA_II.InitialSolutionList(population_size, number_of_objectives, lower_limits_list, upper_limit_list)
code_block_2 = CodeBlock(pop=initialSolutionList) { pop[0]; }
code_block_3 = CodeBlock(pop=initialSolutionList) { pop[1]; }
code_block_4 = CodeBlock(x=code_block_2, y=code_block_3) { Point.ByCoordinates(x,y,0); }
ZAxis = Vector.ZAxis()
code_block_5 = CodeBlock { 200; }
# note: You can replace these two function with your own fitness functions for optimization.
# Please see https://github.com/mrahmaniasl/Optimo/wiki/Setup-Dynamo-Code-for-Optimo for more information.
byStartPointDirectionLength = Line.ByStartPointDirectionLength(code_block_4, ZAxis, code_block_5)
select_face = DSFaceSelection()  # 1 picked in the model
intersect = Geometry.Intersect(byStartPointDirectionLength, select_face, lacing=Longest)
code_block_6 = CodeBlock(intersect) { P.Z; }
code_block_7 = CodeBlock { 1; }
# note: Fitness Function Results must be put in a list to input to AssignFitnessFunctionResults Node. This approach helps this method to be scalabe and accept more than 1 objectives.
flatten = List.Flatten(code_block_6, code_block_7)
create = List.Create(flatten)
assignFitnessFuncResults = Optimo.NSGA_II.AssignFitnessFuncResults(initialSolutionList, create)
create_2 = List.Create(code_block, assignFitnessFuncResults)
iteration_number = CodeBlock { 5; }
loop_completion_check = Custom[Loop Completion Check](Iteration_Number=iteration_number)  # A function that checcks if the loop is completed
nsga_ii_function_point_on = Custom[NSGA_II Function-Point on Surface](loweLomits=lower_limits_list, upperLimits=upper_limit_list)  # The function that does the generation for NSGA_II.
loopWhile = LoopWhile(create_2, loop_completion_check, nsga_ii_function_point_on)
code_block_8 = CodeBlock(a=loopWhile) { a[1]; }
# note: Saves the result to a CSV file.
exportToCSV = File.ExportToCSV(file_path, code_block_8)
code_block_9 = CodeBlock(a=loopWhile) { a[1]; }
# note: Visualizes the optimization results.
code_block_10 = CodeBlock(A=code_block_9) { Point.ByCoordinates(A[0],A[1],A[2]); }
