# Dynamo graph Optimization Example-02-SCH.dyn (Dynamo 0.7.4.3192)

file_path = Filename("C:\Users\t_aslm\Desktop\gbXML\MOO SCH.csv")
code_block = CodeBlock { 1; }
population_size = CodeBlock { 50; }
number_of_objecctives = CodeBlock { 2; }
lower_limit = CodeBlock { -10; }
lower_limit_list = List.Create(lower_limit)
# note: The number of items in lower limit and upper limit lists must be the equal. This number is used as number of variables.
upper_limit = CodeBlock { 12; }
upper_limit_list = List.Create(upper_limit)
initialSolutionList = Optimo.NSGA_II.InitialSolutionList(population_size, number_of_objecctives, lower_limit_list, upper_limit_list)
# note: You can replace these two simple functions with your own functions.
code_block_2 = CodeBlock(pop=initialSolutionList) { pop[0]; }
fitness_function_1 = CodeBlock(x=code_block_2) { Math.Pow(x,2); }
# note: Fitness Function Results must be put in a list to input to AssignFitnessFunctionResults Node. This approach helps this method to be scalabe and accept more than 1 objectives.
fitness_function_2 = CodeBlock(x=code_block_2) { Math.Pow(x-2,2); }
create = List.Create(fitness_function_1, fitness_function_2)
assignFitnessFuncResults = Optimo.NSGA_II.AssignFitnessFuncResults(initialSolutionList, create)
create_2 = List.Create(code_block, assignFitnessFuncResults)
iteration_number = CodeBlock { 50; }
loop_completion_check = Custom[Loop Completion Check](Iteration_Number=iteration_number)  # A function that checcks if the loop is completed
nsga_ii_function_sch = Custom[NSGA_II Function-SCH](loweLomits=lower_limit_list, upperLimits=upper_limit_list)  # The function that does the generation for NSGA_II.
loopWhile = LoopWhile(create_2, loop_completion_check, nsga_ii_function_sch)
code_block_3 = CodeBlock(a=loopWhile) { a[1]; }
# note: Saves the results to a CSV file.
exportToCSV = File.ExportToCSV(file_path, code_block_3)
# note: Visulizes the Pareto Optimal Set
code_block_4 = CodeBlock(Result=code_block_3) { Point.ByCoordinates(Result[1],Result[2],0); }
