# Dynamo custom node Analytical.CreateLineLoadBeta.dyf (Dynamo 0.7.2.2921)
# category: SteamNodes.Analytical
# beta 1

Pairs_of_XYZ_List = Input()  # "Pairs of XYZ (List)"
Z_Force = Input()
byCoordinates = Point.ByCoordinates(arg2=Z_Force)
code_block = CodeBlock { 2; }
ofRepeatedItem = List.OfRepeatedItem(byCoordinates, code_block)
Z_Moment = Input()
byCoordinates_2 = Point.ByCoordinates(arg2=Z_Moment)
ofRepeatedItem_2 = List.OfRepeatedItem(byCoordinates_2, code_block)
Load_Type = Input()
python_script = Python(IN[0]=Pairs_of_XYZ_List, IN[1]=ofRepeatedItem, IN[2]=ofRepeatedItem_2, IN[3]=Load_Type)
# ---------- python_script.python (60 lines) ----------
#python nodes in dynamo 0.7
#proposed by Julien Benoit @jbenoit44 
#http://aecuandme.wordpress.com/
import clr
clr.AddReference('ProtoGeometry')
from Autodesk.DesignScript.Geometry import *
# Import ToDSType(bool) extension method
clr.AddReference("RevitNodes")
import Revit
clr.ImportExtensions(Revit.Elements)
# Import geometry conversion extension methods
clr.ImportExtensions(Revit.GeometryConversion)
# Import DocumentManager and TransactionManager
clr.AddReference("RevitServices")
import RevitServices
from RevitServices.Persistence import DocumentManager
from RevitServices.Transactions import TransactionManager
from System.Collections.Generic import *
# Import RevitAPI
clr.AddReference("RevitAPI")
import Autodesk
from Autodesk.Revit.DB import *
from System.Collections.Generic import *

doc = DocumentManager.Instance.CurrentDBDocument


forces=[]
for i in IN[1]:
	forces.append(UnwrapElement(i).ToXyz(False))
moments=[]
for i in IN[2]:
	moments.append(UnwrapElement(i).ToXyz(False))

loads=[]
loadtype=UnwrapElement(IN[3])
F=List[XYZ](forces)
M=List[XYZ](moments)
p1=XYZ(1,0,0)
p2=XYZ(0,0,1)
p3=XYZ(0,0,0)
p=Plane(p1,p2,p3)


pts = []
for list in IN[0]:
	for i in list:
		pts.append(UnwrapElement(i).ToXyz(False))
		I=List[XYZ](pts)
		# Start Transaction
		doc = DocumentManager.Instance.CurrentDBDocument
		TransactionManager.Instance.EnsureInTransaction(doc)
		skp=SketchPlane.Create(doc,p)
		a=doc.NewLineLoad(I,F,M,True,True,False,loadtype,skp)
		loads.append(a)

		# End Transaction
		TransactionManager.Instance.TransactionTaskDone()

OUT = loads
# ----------------------------------------
LineLoad_s = Output(python_script)  # "LineLoad(s)"
