# Dynamo custom node Element.Create 3D Cropped view.dyf (Dynamo 0.7.2.13394)
# category: SteamNodes.Element
# create 3d view for each element and crop view

element = Input()
boundingBox = Element.BoundingBox(element)
minPoint = BoundingBox.MinPoint(boundingBox)
Offset = Input()
code_block = CodeBlock(a=Offset) { -a; }
byCoordinates = Vector.ByCoordinates(code_block, code_block, code_block)
add = Point.Add(minPoint, byCoordinates)
maxPoint = BoundingBox.MaxPoint(boundingBox)
byCoordinates_2 = Vector.ByCoordinates(Offset, Offset, Offset)
add_2 = Point.Add(maxPoint, byCoordinates_2)
byCorners = Cuboid.ByCorners(add, add_2, lacing=Longest)
byGeometry = BoundingBox.ByGeometry(byCorners, lacing=Longest)
minPoint_2 = BoundingBox.MinPoint(byGeometry)
maxPoint_2 = BoundingBox.MaxPoint(byGeometry)
python_script = Python(IN[0]=minPoint_2, IN[1]=maxPoint_2)
# ---------- python_script.python (56 lines) ----------
import clr
clr.AddReference('ProtoGeometry')
from Autodesk.DesignScript.Geometry import *
# Import ToDSType(bool) extension method
clr.AddReference("RevitNodes")
import Revit
clr.ImportExtensions(Revit.Elements)
# Import geometry conversion extension methods
clr.ImportExtensions(Revit.GeometryConversion)
# Import DocumentManager and TransactionManager
clr.AddReference("RevitServices")
import RevitServices
from RevitServices.Persistence import DocumentManager
from RevitServices.Transactions import TransactionManager
from System.Collections.Generic import *
# Import RevitAPI
clr.AddReference("RevitAPI")
import Autodesk
from Autodesk.Revit.DB import *

doc = DocumentManager.Instance.CurrentDBDocument
uiapp = DocumentManager.Instance.CurrentUIApplication
app = uiapp.Application
uidoc=DocumentManager.Instance.CurrentUIApplication.ActiveUIDocument

Min=[]
Max=[]
viewlist=[]
bbox=[]
for i in IN[0]:
	Min.append(UnwrapElement(i.ToXyz(True)))
for i in IN[1]:
	Max.append(UnwrapElement(i.ToXyz(True)))



# Start Transaction
TransactionManager.Instance.EnsureInTransaction(doc)
activeview=doc.ActiveView
typeid=View.GetTypeId(activeview)

count = 0
while (count < len(Min)):
	b=View3D.CreateIsometric(doc, typeid)
	viewlist.append(b)
	box = app.Create.NewBoundingBoxXYZ()
	box.Min = Min[count]
	box.Max = Max[count]
	bbox.append(box)
	a=View3D.SetSectionBox(b,box)
	count = count + 1
	

# End Transaction
TransactionManager.Instance.TransactionTaskDone()
OUT=bbox,viewlist
# ----------------------------------------
code_block_2 = CodeBlock(a=python_script) { a[0]; a[1]; }
Views = Output(code_block_2.out1)
Bbox = Output(code_block_2.out0)
watch = Watch(python_script)
