# Dynamo custom node Element.Parts.Getparents.dyf (Dynamo 0.7.2.2921)
# category: SteamNodes.Element
# Returns parents of selected Parts

Part_s = Input()  # "Part(s)"
code_block = CodeBlock(item=Part_s) { Flatten({item}); }
python_script = Python(IN[0]=code_block)
# ---------- python_script.python (57 lines) ----------
#python nodes in dynamo 0.7
#proposed by Julien Benoit @jbenoit44 
#http://aecuandme.wordpress.com/
import clr
clr.AddReference('ProtoGeometry')
from Autodesk.DesignScript.Geometry import *

# Import ToDSType(bool) extension method
clr.AddReference("RevitNodes")
import Revit
clr.ImportExtensions(Revit.Elements)

# Import DocumentManager and TransactionManager
clr.AddReference("RevitServices")
import RevitServices
from RevitServices.Persistence import DocumentManager
from RevitServices.Transactions import TransactionManager

from System.Collections.Generic import *

# Import RevitAPI
clr.AddReference("RevitAPI")
import Autodesk

doc = DocumentManager.Instance.CurrentDBDocument
uiapp = DocumentManager.Instance.CurrentUIApplication
app = uiapp.Application

#The inputs to this node will be stored as a list in the IN variable.
dataEnteringNode = IN

#unwrap all elements to use with API
elements = []
for i in IN[0]:
	elements.append(UnwrapElement(i))
	
# "Start" the transaction
TransactionManager.Instance.EnsureInTransaction(doc)

elementlist = list()
for item in elements:
    sourcelist = list()
    for source in item.GetSourceElementIds():
        sourcelist.append(doc.GetElement(source.HostElementId))
    if len(sourcelist) < 2:
        elementlist.append(sourcelist[0])
    else:
        elementlist.append(sourcelist)



# "End" the transaction
TransactionManager.Instance.TransactionTaskDone()


#Assign your output to the OUT variable
OUT = (elementlist)
# ----------------------------------------
Output = Output(python_script)  # ""
