# Dynamo custom node Element.TypeName.dyf (Dynamo 0.7.2.2921)
# category: SteamNodes.Element
# Get Type Name as string

Input = Input()
python_script = Python(IN[0]=Input)
# ---------- python_script.python (45 lines) ----------
#python nodes in dynamo 0.7
#proposed by Julien Benoit @jbenoit44 
#http://aecuandme.wordpress.com/
import clr
clr.AddReference('ProtoGeometry')
from Autodesk.DesignScript.Geometry import *

# Import ToDSType(bool) extension method
clr.AddReference("RevitNodes")
import Revit
clr.ImportExtensions(Revit.Elements)

# Import DocumentManager and TransactionManager
clr.AddReference("RevitServices")
import RevitServices
from RevitServices.Persistence import DocumentManager
from RevitServices.Transactions import TransactionManager

from System.Collections.Generic import *

# Import RevitAPI
clr.AddReference("RevitAPI")
import Autodesk

doc = DocumentManager.Instance.CurrentDBDocument
uiapp = DocumentManager.Instance.CurrentUIApplication
app = uiapp.Application

dataEnteringNode = IN[0]

#unwrap all elements to use with API
a=UnwrapElement(IN[0])
	
# "Start" the transaction
TransactionManager.Instance.EnsureInTransaction(doc)

b=a.GetType().ToString()


# "End" the transaction
TransactionManager.Instance.TransactionTaskDone()


#Assign your output to the OUT variable
OUT = b
# ----------------------------------------
Output = Output(python_script)  # ""
