# Dynamo custom node List.FilterByString.dyf (Dynamo 0.7.2.2921)
# category: SteamNodes.List
# Filter a list by a string match

list = Input()
code_block = CodeBlock(item=list) { Flatten({item}); }
fromObject = String.FromObject()
String = Input()
boolean = BoolSelector(true)
contains = String.Contains(arg1=String, arg2=boolean)
compose = ComposeFunctions(fromObject, contains)  # "Function.Compose"
filter = List.Filter(code_block, compose)
Match = Output(filter.out0)
Other = Output(filter.out1)
