# Dynamo custom node Schedule.GetTextFromHeader.dyf (Dynamo 0.7.2.2921)
# category: SteamNodes.Schedule
# from Viewschedule input, returns columns header values as text

ViewSchedule_s = Input()  # "ViewSchedule(s)"
code_block = CodeBlock(item=ViewSchedule_s) { Flatten({item}); }
python_script = Python(IN[0]=code_block)
# ---------- python_script.python (44 lines) ----------
#python nodes in dynamo 0.7
#proposed by Julien Benoit @jbenoit44 
#http://aecuandme.wordpress.com/
import clr
clr.AddReference('ProtoGeometry')
from Autodesk.DesignScript.Geometry import *
# Import ToDSType(bool) extension method
clr.AddReference("RevitNodes")
import Revit
clr.ImportExtensions(Revit.Elements)
# Import geometry conversion extension methods
clr.ImportExtensions(Revit.GeometryConversion)
# Import DocumentManager and TransactionManager
clr.AddReference("RevitServices")
import RevitServices
from RevitServices.Persistence import DocumentManager
from RevitServices.Transactions import TransactionManager
from System.Collections.Generic import *
# Import RevitAPI
clr.AddReference("RevitAPI")
import Autodesk
from Autodesk.Revit.DB import *

doc = DocumentManager.Instance.CurrentDBDocument
uiapp = DocumentManager.Instance.CurrentUIApplication
app = uiapp.Application
uidoc=DocumentManager.Instance.CurrentUIApplication.ActiveUIDocument

elt = []
for i in IN[0]:
	elt.append(UnwrapElement(i))
list=[]

# Start Transaction
TransactionManager.Instance.EnsureInTransaction(doc)
for v in elt:
	b=SectionType.Header
	a=v.GetCellText(b,0,0)
	list.append(a)

# End Transaction
TransactionManager.Instance.TransactionTaskDone()

OUT=list
# ----------------------------------------
Header_s = Output(python_script)  # "Header(s)"
