# Dynamo custom node Tool.GetLineStyleByName.dyf (Dynamo 0.7.2.2921)
# category: SteamNodes.Tool
# Collects LineStyle from string.contains

empty = List.Empty()
python_script = Python(IN[0]=empty)
# ---------- python_script.python (57 lines) ----------
#python nodes in dynamo 0.7
#proposed by Julien Benoit @jbenoit44 
#http://aecuandme.wordpress.com/
import clr
clr.AddReference('ProtoGeometry')
from Autodesk.DesignScript.Geometry import *
# Import ToDSType(bool) extension method
clr.AddReference("RevitNodes")
import Revit
clr.ImportExtensions(Revit.Elements)
# Import geometry conversion extension methods
clr.ImportExtensions(Revit.GeometryConversion)
# Import DocumentManager and TransactionManager
clr.AddReference("RevitServices")
import RevitServices
from RevitServices.Persistence import DocumentManager
from RevitServices.Transactions import TransactionManager
from System.Collections.Generic import *
# Import RevitAPI
clr.AddReference("RevitAPI")
import Autodesk
from Autodesk.Revit.DB import *

doc = DocumentManager.Instance.CurrentDBDocument
uiapp = DocumentManager.Instance.CurrentUIApplication
app = uiapp.Application
uidoc=DocumentManager.Instance.CurrentUIApplication.ActiveUIDocument

elt = []
#for i in IN[0]:
#	elt.append(UnwrapElement(i))
#cat=[]
# Start Transaction
TransactionManager.Instance.EnsureInTransaction(doc)
list=[]
#for e in elt:
a=UnwrapElement(IN[0])
a=doc.Settings.Categories.get_Item(BuiltInCategory.OST_Lines)
b=a.SubCategories

for i in b:
	c=i.Name.ToString()
	list.append(c)
	#elt.append(d)

#for i in elt:
#	if UnwrapElement(IN[0]).CanAddSubcategory == True:
#		b=i.Name
#		list.append(b)
#cat.append(a)
#Assign your output to the OUT variable


# End Transaction
TransactionManager.Instance.TransactionTaskDone()

OUT = b,list
# ----------------------------------------
code_block = CodeBlock(list=python_script) { list[0]; list[1]; }
Contains_String = Input()
Ignore_Case_boolean = Input()  # "Ignore Case (boolean)"
contains = String.Contains(code_block.out1, Contains_String, Ignore_Case_boolean)
filterByBoolMask = List.FilterByBoolMask(code_block.out0, contains)
LineStyle_Internal = Output(filterByBoolMask)  # "LineStyle (Internal)"
filterByBoolMask_2 = List.FilterByBoolMask(code_block.out1, contains)
LineStyle_Name = Output(filterByBoolMask_2)  # "LineStyle(Name)"
All_LineStyle = Output(code_block.out0)
sort = List.Sort(code_block.out1)
All_LS_Names = Output(sort)
