# Dynamo custom node Tool.GetPhaseByName.dyf (Dynamo 0.7.2.2921)
# category: SteamNodes.Tool
# Get Document Phases by String

empty = List.Empty()
python_script = Python(IN[0]=empty)
# ---------- python_script.python (40 lines) ----------
#python nodes in dynamo 0.7
#proposed by Julien Benoit @jbenoit44 
#http://aecuandme.wordpress.com/
import clr
clr.AddReference('ProtoGeometry')
from Autodesk.DesignScript.Geometry import *
# Import ToDSType(bool) extension method
clr.AddReference("RevitNodes")
import Revit
clr.ImportExtensions(Revit.Elements)
# Import geometry conversion extension methods
clr.ImportExtensions(Revit.GeometryConversion)
# Import DocumentManager and TransactionManager
clr.AddReference("RevitServices")
import RevitServices
from RevitServices.Persistence import DocumentManager
from RevitServices.Transactions import TransactionManager
from System.Collections.Generic import *
# Import RevitAPI
clr.AddReference("RevitAPI")
import Autodesk
from Autodesk.Revit.DB import *

doc = DocumentManager.Instance.CurrentDBDocument
uiapp = DocumentManager.Instance.CurrentUIApplication
app = uiapp.Application
uidoc=DocumentManager.Instance.CurrentUIApplication.ActiveUIDocument

phases=[]
names=[]
phaseslist=doc.Phases
# Start Transaction
TransactionManager.Instance.EnsureInTransaction(doc)
for p in phaseslist:
	phases.append(p.ToDSType(False))
	names.append(p.Name)

# End Transaction
TransactionManager.Instance.TransactionTaskDone()
OUT =phases,names
# ----------------------------------------
code_block = CodeBlock { 0; }
getItemAtIndex = List.GetItemAtIndex(python_script, code_block)
code_block_2 = CodeBlock { 1; }
getItemAtIndex_2 = List.GetItemAtIndex(python_script, code_block_2)
Phase_Name_string = Input()  # "Phase Name(string)"
boolean = BoolSelector(true)
contains = String.Contains(getItemAtIndex_2, Phase_Name_string, boolean)
filterByBoolMask = List.FilterByBoolMask(getItemAtIndex, contains)
Phase = Output(filterByBoolMask)
filterByBoolMask_2 = List.FilterByBoolMask(getItemAtIndex_2, contains)
Phase_Name = Output(filterByBoolMask_2)
