# Dynamo custom node Tool.GetRevitSelection.dyf (Dynamo 0.7.2.2921)
# category: SteamNodes.Tool
# get the selection from the revit UI, works for views

empty = List.Empty()
python_script = Python(IN[0]=empty)
# ---------- python_script.python (31 lines) ----------
#python nodes in dynamo 0.7
#proposed by Julien Benoit @jbenoit44 
#http://aecuandme.wordpress.com/
import clr
clr.AddReference('ProtoGeometry')
from Autodesk.DesignScript.Geometry import *
# Import ToDSType(bool) extension method
clr.AddReference("RevitNodes")
import Revit
clr.ImportExtensions(Revit.Elements)
# Import geometry conversion extension methods
clr.ImportExtensions(Revit.GeometryConversion)
# Import DocumentManager and TransactionManager
clr.AddReference("RevitServices")
import RevitServices
from RevitServices.Persistence import DocumentManager
from RevitServices.Transactions import TransactionManager
from System.Collections.Generic import *
# Import RevitAPI
clr.AddReference("RevitAPI")
import Autodesk
from Autodesk.Revit.DB import *

doc = DocumentManager.Instance.CurrentDBDocument
uiapp = DocumentManager.Instance.CurrentUIApplication
app = uiapp.Application

uidoc=DocumentManager.Instance.CurrentUIApplication.ActiveUIDocument


OUT=uidoc.Selection.Elements
# ----------------------------------------
Internal = Output(python_script)
empty_2 = List.Empty()
python_script_2 = Python(IN[0]=empty_2)
# ---------- python_script_2.python (37 lines) ----------
#python nodes in dynamo 0.7
#proposed by Julien Benoit @jbenoit44 
#http://aecuandme.wordpress.com/
import clr
clr.AddReference('ProtoGeometry')
from Autodesk.DesignScript.Geometry import *
# Import ToDSType(bool) extension method
clr.AddReference("RevitNodes")
import Revit
clr.ImportExtensions(Revit.Elements)
# Import geometry conversion extension methods
clr.ImportExtensions(Revit.GeometryConversion)
# Import DocumentManager and TransactionManager
clr.AddReference("RevitServices")
import RevitServices
from RevitServices.Persistence import DocumentManager
from RevitServices.Transactions import TransactionManager
from System.Collections.Generic import *
# Import RevitAPI
clr.AddReference("RevitAPI")
import Autodesk
from Autodesk.Revit.DB import *

doc = DocumentManager.Instance.CurrentDBDocument
uiapp = DocumentManager.Instance.CurrentUIApplication
app = uiapp.Application
uidoc=DocumentManager.Instance.CurrentUIApplication.ActiveUIDocument

sel=[]
elt=[]

sel=uidoc.Selection.Elements

for i in sel:
	elt.append(i.ToDSType(False))

OUT=elt
# ----------------------------------------
Element = Output(python_script_2)
