# Dynamo custom node Tool.PlaceGroupAtPoint.dyf (Dynamo 0.7.2.2921)
# category: SteamNodes.Tool
# place a given group at given points

element_types = ElementTypes("Group")
all_elements_of_type = ElementsOfType(element_types)
name = Element.Name(all_elements_of_type)
Group_Name_as_String = Input()
equals = Equals(name, Group_Name_as_String)
filterByBoolMask = List.FilterByBoolMask(all_elements_of_type, equals, lacing=Longest)
firstItem = List.FirstItem(filterByBoolMask)
Point_s = Input()  # "Point(s)"
code_block = CodeBlock(item=Point_s) { Flatten({item}); }
python_script = Python(IN[0]=firstItem, IN[1]=code_block)
# ---------- python_script.python (46 lines) ----------
#python nodes in dynamo 0.7
#proposed by Julien Benoit @jbenoit44 
#http://aecuandme.wordpress.com/
import clr
clr.AddReference('ProtoGeometry')
from Autodesk.DesignScript.Geometry import *
# Import ToDSType(bool) extension method
clr.AddReference("RevitNodes")
import Revit
clr.ImportExtensions(Revit.Elements)
# Import geometry conversion extension methods
clr.ImportExtensions(Revit.GeometryConversion)
# Import DocumentManager and TransactionManager
clr.AddReference("RevitServices")
import RevitServices
from RevitServices.Persistence import DocumentManager
from RevitServices.Transactions import TransactionManager
from System.Collections.Generic import *
# Import RevitAPI
clr.AddReference("RevitAPI")
import Autodesk
from Autodesk.Revit.DB import *

doc = DocumentManager.Instance.CurrentDBDocument
uiapp = DocumentManager.Instance.CurrentUIApplication
app = uiapp.Application

#feed IN[0] with a GroupType
grp=UnwrapElement(IN[0])

#unwrap the points and turn into XYZ, UI units
pts = []
for i in IN[1]:
	pts.append(UnwrapElement(i.ToXyz(False)))

# Start Transaction
TransactionManager.Instance.EnsureInTransaction(doc)

#Revit API to place a group at XYZ
for pt in pts:
	b=doc.Create.PlaceGroup(pt,grp)
	
# End Transaction
TransactionManager.Instance.TransactionTaskDone()

OUT = grp
# ----------------------------------------
name_2 = Element.Name(python_script)
Group_Name = Output(name_2)
