# Dynamo custom node Tool.RemoveVoidCut.dyf (Dynamo 0.7.2.2921)
# category: SteamNodes.Tool
# Add void cut for a Set of elements. In combination with Get surrounding elements node.

List_from_GetSurrounding = Input()
deconstruct = List.Deconstruct()
map = List.Map(List_from_GetSurrounding, deconstruct.out0)
map_2 = List.Map(List_from_GetSurrounding, deconstruct.out1)
python_script = Python(IN[0]=map, IN[1]=map_2)
# ---------- python_script.python (52 lines) ----------
#python nodes in dynamo 0.7
#proposed by Julien Benoit @jbenoit44 
#http://aecuandme.wordpress.com/
import clr
clr.AddReference('ProtoGeometry')
from Autodesk.DesignScript.Geometry import *
# Import ToDSType(bool) extension method
clr.AddReference("RevitNodes")
import Revit
clr.ImportExtensions(Revit.Elements)
# Import geometry conversion extension methods
clr.ImportExtensions(Revit.GeometryConversion)
# Import DocumentManager and TransactionManager
clr.AddReference("RevitServices")
import RevitServices
from RevitServices.Persistence import DocumentManager
from RevitServices.Transactions import TransactionManager
from System.Collections.Generic import *
# Import RevitAPI
clr.AddReference("RevitAPI")
import Autodesk
from Autodesk.Revit.DB import *

doc = DocumentManager.Instance.CurrentDBDocument
uiapp = DocumentManager.Instance.CurrentUIApplication
app = uiapp.Application
uidoc=DocumentManager.Instance.CurrentUIApplication.ActiveUIDocument

host = []
for i in IN[0]:
	host.append(UnwrapElement(i))

cutins=[]

cutfam = UnwrapElement(IN[1])

# Start Transaction
TransactionManager.Instance.EnsureInTransaction(doc)

for h in host:
	for list in cutfam:
		for c in list:
			try:
				InstanceVoidCutUtils.RemoveInstanceVoidCut(doc,h,c)	
				cutted.append(h.Id)
			except:
				0	
# End Transaction
TransactionManager.Instance.TransactionTaskDone()
doc.Regenerate()
#Assign your output to the OUT variable
OUT = 0
# ----------------------------------------
Output = Output(python_script)  # ""
