# Dynamo graph Get Multiple Elements Nodal Coordinates.dyn (Dynamo 1.0.0.1180)

file_path = Filename(".\Dynamo-GSA_match_test%20_Demo%20Model.xlsm")
sheetName = CodeBlock { "Revit Elements"; }
startRow = CodeBlock { 0; }
startCol = CodeBlock { 0; }
code_block = CodeBlock { "Revit ID"; "X1"; "Y1"; "Z1"; "X2"; "Y2"; "Z2"; "Xm"; "Ym"; "Zm"; }
create = List.Create(code_block.out0, code_block.out1, code_block.out2, code_block.out3, code_block.out4, code_block.out5, code_block.out6, code_block.out7, code_block.out8, code_block.out9)
code_block_2 = CodeBlock { 0; }
code_block_3 = CodeBlock { 1; }
sublists = List.Sublists(list=create, ranges=code_block_2, offset=code_block_3)
transpose = List.Transpose(sublists)
select_model_elements = DSModelElementsSelection()
id = Element.Id(select_model_elements)
code_block_4 = CodeBlock { 0; 1; }
sublists_2 = List.Sublists(list=id, ranges=code_block_4.out0, offset=code_block_4.out1)
transpose_2 = List.Transpose(sublists_2)
code_block_5 = CodeBlock { "Project X"; }
getParameterValueByName = Element.GetParameterValueByName(element=select_model_elements, parameterName=code_block_5)
sublists_3 = List.Sublists(list=getParameterValueByName, ranges=code_block_4.out0, offset=code_block_4.out1)
transpose_3 = List.Transpose(sublists_3)
code_block_6 = CodeBlock { "Project Y"; }
getParameterValueByName_2 = Element.GetParameterValueByName(element=select_model_elements, parameterName=code_block_6)
sublists_4 = List.Sublists(list=getParameterValueByName_2, ranges=code_block_4.out0, offset=code_block_4.out1)
transpose_4 = List.Transpose(sublists_4)
code_block_7 = CodeBlock { "Project Z"; }
getParameterValueByName_3 = Element.GetParameterValueByName(element=select_model_elements, parameterName=code_block_7)
sublists_5 = List.Sublists(list=getParameterValueByName_3, ranges=code_block_4.out0, offset=code_block_4.out1)
transpose_5 = List.Transpose(sublists_5)
code_block_8 = CodeBlock { "Project X2"; }
getParameterValueByName_4 = Element.GetParameterValueByName(element=select_model_elements, parameterName=code_block_8)
sublists_6 = List.Sublists(list=getParameterValueByName_4, ranges=code_block_4.out0, offset=code_block_4.out1)
transpose_6 = List.Transpose(sublists_6)
code_block_9 = CodeBlock { "Project Y2"; }
getParameterValueByName_5 = Element.GetParameterValueByName(element=select_model_elements, parameterName=code_block_9)
sublists_7 = List.Sublists(list=getParameterValueByName_5, ranges=code_block_4.out0, offset=code_block_4.out1)
transpose_7 = List.Transpose(sublists_7)
code_block_10 = CodeBlock { "Project Z2"; }
getParameterValueByName_6 = Element.GetParameterValueByName(element=select_model_elements, parameterName=code_block_10)
sublists_8 = List.Sublists(list=getParameterValueByName_6, ranges=code_block_4.out0, offset=code_block_4.out1)
transpose_8 = List.Transpose(sublists_8)
code_block_11 = CodeBlock(x1=getParameterValueByName, x2=getParameterValueByName_4, y1=getParameterValueByName_2, y2=getParameterValueByName_5, z1=getParameterValueByName_3, z2=getParameterValueByName_6) { x1; x2; y1; y2; z1; z2; xm = (x1+x2)/2; ym = (y1+y2)/2; zm = (z1+z2)/2; }
sublists_9 = List.Sublists(list=code_block_11.xm, ranges=code_block_4.out0, offset=code_block_4.out1)
transpose_9 = List.Transpose(sublists_9)
sublists_10 = List.Sublists(list=code_block_11.ym, ranges=code_block_4.out0, offset=code_block_4.out1)
transpose_10 = List.Transpose(sublists_10)
sublists_11 = List.Sublists(list=code_block_11.zm, ranges=code_block_4.out0, offset=code_block_4.out1)
transpose_11 = List.Transpose(sublists_11)
join = List.Join(transpose_2, transpose_3, transpose_4, transpose_5, transpose_6, transpose_7, transpose_8, transpose_9, transpose_10, transpose_11)
transpose_12 = List.Transpose(join)
sublists_12 = List.Sublists(list=transpose_12, ranges=code_block_2, offset=code_block_3)
code_block_12 = CodeBlock { 1; }
flatten = List.Flatten(list=sublists_12, amt=code_block_12)
join_2 = List.Join(transpose, flatten)
writeToFile = Excel.WriteToFile(filePath=file_path, sheetName=sheetName, startRow=startRow, startCol=startCol, data=join_2)
