# Dynamo graph Get Single Element Nodal Coordinates.dyn (Dynamo 0.9.1.4062)

file_path = Filename("C:\Users\Aristotelis.Papagian\Desktop\Dynamo test.xlsx")
sheetName = CodeBlock { "Revit Elements"; }
startRow = CodeBlock { 0; }
startCol = CodeBlock { 0; }
code_block = CodeBlock { "Revit ID"; "X1"; "Y1"; "Z1"; "X2"; "Y2"; "Z2"; "Xm"; "Ym"; "Zm"; }
create = List.Create(code_block.out0, code_block.out1, code_block.out2, code_block.out3, code_block.out4, code_block.out5, code_block.out6, code_block.out7, code_block.out8, code_block.out9)
code_block_2 = CodeBlock { 0; }
code_block_3 = CodeBlock { 1; }
sublists = List.Sublists(list=create, ranges=code_block_2, offset=code_block_3)
transpose = List.Transpose(sublists)
select_model_element = DSModelElementSelection()  # 1 picked in the model
id = Element.Id(select_model_element)
code_block_4 = CodeBlock { "Project X"; }
getParameterValueByName = Element.GetParameterValueByName(element=select_model_element, parameterName=code_block_4)
code_block_5 = CodeBlock { "Project Y"; }
getParameterValueByName_2 = Element.GetParameterValueByName(element=select_model_element, parameterName=code_block_5)
code_block_6 = CodeBlock { "Project Z"; }
getParameterValueByName_3 = Element.GetParameterValueByName(element=select_model_element, parameterName=code_block_6)
code_block_7 = CodeBlock { "Project X2"; }
getParameterValueByName_4 = Element.GetParameterValueByName(element=select_model_element, parameterName=code_block_7)
code_block_8 = CodeBlock { "Project Y2"; }
getParameterValueByName_5 = Element.GetParameterValueByName(element=select_model_element, parameterName=code_block_8)
code_block_9 = CodeBlock { "Project Z2"; }
getParameterValueByName_6 = Element.GetParameterValueByName(element=select_model_element, parameterName=code_block_9)
code_block_10 = CodeBlock(x1=getParameterValueByName, x2=getParameterValueByName_4, y1=getParameterValueByName_2, y2=getParameterValueByName_5, z1=getParameterValueByName_3, z2=getParameterValueByName_6) { x1; x2; y1; y2; z1; z2; xm = (x1+x2)/2; ym = (y1+y2)/2; zm = (z1+z2)/2; }
join = List.Join(id, getParameterValueByName, getParameterValueByName_2, getParameterValueByName_3, getParameterValueByName_4, getParameterValueByName_5, getParameterValueByName_6, code_block_10.xm, code_block_10.ym, code_block_10.zm)
sublists_2 = List.Sublists(list=join, ranges=code_block_2, offset=code_block_3)
transpose_2 = List.Transpose(sublists_2)
join_2 = List.Join(transpose, transpose_2)
writeToFile = Excel.WriteToFile(filePath=file_path, sheetName=sheetName, startRow=startRow, startCol=startCol, data=join_2)
