# Dynamo graph Beam Mark Numbering.dyn (Dynamo 1.0.0.1180)

categories = Categories("StructuralFraming")
all_elements_of_category = ElementsOfCategory(categories)
string = StringInput("Start Level Offset")
parameterExists = Custom[Element.ParameterExists](param=string, element=all_elements_of_category)  # Checks if an element contains a parameter of a given name
watch = Watch(parameterExists)
filterByBoolMask = List.FilterByBoolMask(list=all_elements_of_category, mask=watch)
string_2 = StringInput("Type")
getParameterValueByName = Element.GetParameterValueByName(element=filterByBoolMask.in, parameterName=string_2)
string_from_object = FromObject(getParameterValueByName)
code_block = CodeBlock { ":"; }
split = String.Split(string_from_object, code_block)
transpose = List.Transpose(split)
number = DoubleInput(0)
getItemAtIndex = List.GetItemAtIndex(list=transpose, index=number)
uniqueId = Element.UniqueId(filterByBoolMask.in)
code_block_2 = CodeBlock { "B"; }
string_3 = StringInput("Reference Level")
getParameterValueByName_2 = Element.GetParameterValueByName(element=filterByBoolMask.in, parameterName=string_3)
name = Level.Name(getParameterValueByName_2)
code_block_3 = CodeBlock { " "; }
split_2 = String.Split(name, code_block_3)
transpose_2 = List.Transpose(split_2)
number_2 = DoubleInput(0)
getItemAtIndex_2 = List.GetItemAtIndex(list=transpose_2, index=number_2)
transpose_3 = List.Transpose(getItemAtIndex_2)
watch_2 = Watch(transpose_3)
number_3 = DoubleInput(1)
number_4 = DoubleInput(200)
number_5 = DoubleInput(1)
sequence = Sequence(start=number_3, amount=number_4, step=number_5, lacing=Longest)
transpose_4 = List.Transpose(sequence)
code_block_4 = CodeBlock(a=code_block_2, b=watch_2, c=transpose_4) { a+b+c; }
create = List.Create(uniqueId, code_block_4)
code_block_5 = CodeBlock { 0; }
getItemAtIndex_3 = List.GetItemAtIndex(list=create, index=code_block_5)
code_block_6 = CodeBlock(id=getItemAtIndex_3) { ElementSelector.ByUniqueId(id, true); }
string_4 = StringInput("Mark")
setParameterByName = Element.SetParameterByName(element=code_block_6, parameterName=string_4, value=code_block_4)
watch_3 = Watch(setParameterByName)
