# Dynamo graph Column Mark Numbering.dyn (Dynamo 1.0.0.1180)

categories = Categories("StructuralColumns")
all_elements_of_category = ElementsOfCategory(categories)
uniqueId = Element.UniqueId(all_elements_of_category)
code_block = CodeBlock { "C"; }
string = StringInput("Base Level")
getParameterValueByName = Element.GetParameterValueByName(element=all_elements_of_category, parameterName=string)
name = Level.Name(getParameterValueByName)
code_block_2 = CodeBlock { " "; }
split = String.Split(name, code_block_2)
transpose = List.Transpose(split)
number = DoubleInput(0)
getItemAtIndex = List.GetItemAtIndex(list=transpose, index=number)
number_2 = DoubleInput(1)
number_3 = DoubleInput(200)
number_4 = DoubleInput(1)
sequence = Sequence(start=number_2, amount=number_3, step=number_4, lacing=Longest)
transpose_2 = List.Transpose(sequence)
code_block_3 = CodeBlock(a=code_block, b=getItemAtIndex, c=transpose_2) { a+b+c; }
create = List.Create(uniqueId, code_block_3)
code_block_4 = CodeBlock { 0; }
getItemAtIndex_2 = List.GetItemAtIndex(list=create, index=code_block_4)
code_block_5 = CodeBlock(id=getItemAtIndex_2) { ElementSelector.ByUniqueId(id, true); }
string_2 = StringInput("Mark")
setParameterByName = Element.SetParameterByName(element=code_block_5, parameterName=string_2, value=code_block_3)
string_3 = StringInput("Type")
getParameterValueByName_2 = Element.GetParameterValueByName(element=all_elements_of_category, parameterName=string_3)
string_from_object = FromObject(getParameterValueByName_2)
code_block_6 = CodeBlock { ":"; }
split_2 = String.Split(string_from_object, code_block_6)
transpose_3 = List.Transpose(split_2)
number_5 = DoubleInput(0)
getItemAtIndex_3 = List.GetItemAtIndex(list=transpose_3, index=number_5)
