# Dynamo graph Structural Framing Location to Excel.dyn (Dynamo 1.1.0.2094)

file_path = Filename("Z:\National\Group\BIM\2-Projects\AUS Region Blgs 1516FY\02_Structure\Demo Model\Dynamo\Structural Framing to Excel\Structural Framing to Excel.xlsx")
string = StringInput("Beam Locations")
number = DoubleInput(1)
number_2 = DoubleInput(1)
categories = Categories("StructuralFraming")
all_elements_of_category = ElementsOfCategory(categories)
string_2 = StringInput("Project X")
getParameterValueByName = Element.GetParameterValueByName(element=all_elements_of_category, parameterName=string_2)
string_3 = StringInput("Project Y")
getParameterValueByName_2 = Element.GetParameterValueByName(element=all_elements_of_category, parameterName=string_3)
string_4 = StringInput("Project Z")
getParameterValueByName_3 = Element.GetParameterValueByName(element=all_elements_of_category, parameterName=string_4)
create = List.Create(getParameterValueByName, getParameterValueByName_2, getParameterValueByName_3)
transpose = List.Transpose(create)
writeToFile = Excel.WriteToFile(filePath=file_path, sheetName=string, startRow=number, startCol=number_2, data=transpose)
watch = Watch(create)
string_5 = StringInput("Project X2")
getParameterValueByName_4 = Element.GetParameterValueByName(element=all_elements_of_category, parameterName=string_5)
string_6 = StringInput("Project Y2")
getParameterValueByName_5 = Element.GetParameterValueByName(element=all_elements_of_category, parameterName=string_6)
string_7 = StringInput("Project Z2")
getParameterValueByName_6 = Element.GetParameterValueByName(element=all_elements_of_category, parameterName=string_7)
create_2 = List.Create(getParameterValueByName_4, getParameterValueByName_5, getParameterValueByName_6)
watch_2 = Watch(create_2)
file_path_2 = Filename("Z:\National\Group\BIM\2-Projects\AUS Region Blgs 1516FY\02_Structure\Demo Model\Dynamo\Structural Framing to Excel\Structural Framing to Excel.xlsx")
string_8 = StringInput("Beam Locations")
number_3 = DoubleInput(1)
number_4 = DoubleInput(4)
transpose_2 = List.Transpose(create_2)
writeToFile_2 = Excel.WriteToFile(filePath=file_path_2, sheetName=string_8, startRow=number_3, startCol=number_4, data=transpose_2)
file_path_3 = Filename("Z:\National\Group\BIM\2-Projects\AUS Region Blgs 1516FY\02_Structure\Demo Model\Dynamo\Structural Framing to Excel\Structural Framing to Excel.xlsx")
string_9 = StringInput("Beam Locations")
number_5 = DoubleInput(1)
number_6 = DoubleInput(0)
string_10 = StringInput("Mark")
getParameterValueByName_7 = Element.GetParameterValueByName(element=all_elements_of_category, parameterName=string_10)
writeToFile_3 = Excel.WriteToFile(filePath=file_path_3, sheetName=string_9, startRow=number_5, startCol=number_6, data=getParameterValueByName_7)
file_path_4 = Filename("Z:\National\Group\BIM\2-Projects\AUS Region Blgs 1516FY\02_Structure\Demo Model\Dynamo\Structural Framing to Excel\Structural Framing to Excel.xlsx")
string_11 = StringInput("Element Location Node")
number_7 = DoubleInput(0)
number_8 = DoubleInput(0)
categories_2 = Categories("StructuralFraming")
all_elements_of_category_2 = ElementsOfCategory(categories_2)
location = Custom[Element.Location](element=all_elements_of_category_2)  # Returns the location of an element as an XYZ (or if it's line-based the start and end point of the line), along with some booleans to help filtering the results. Use this for some element types (e.g. walls or lines) that do not work with the built-in Get Family Instance Location node.
writeToFile_4 = Excel.WriteToFile(filePath=file_path_4, sheetName=string_11, startRow=number_7, startCol=number_8, data=location.curveEndpoints)
