# Dynamo graph Shadow Area.dyn (Dynamo 1.2.0.2573)

siteLocation = SiteLocation()
byLocation = DynamoSolarAnalysis.Weather.Weather.ByLocation(siteLocation)
select_face = DSFaceSelection()  # 1 picked in the model
select_model_element = DSModelElementSelection()  # 1 picked in the model
geometry = Element.Geometry(select_model_element)
faces = Element.Faces(geometry)
surfaceGeometry = Face.SurfaceGeometry(faces)
date_time = DateTime("September 17, 2016 1:52 PM")
still = DynamoSolarAnalysis.Analysis.TimeStudy.Still(date_time)
code_block = CodeBlock { 10; 0; }
analyze = DynamoSolarAnalysis.Analysis.SolarAnalysis.Analyze(byLocation, select_face, surfaceGeometry, still, code_block.out0, code_block.out1, lacing=Longest)
flatten = Flatten(analyze.out3)
flatten_2 = Flatten(analyze.out2)
remapRange = Math.RemapRange(numbers=flatten_2)
number = DoubleInput(0.1)
lt = remapRange < number
filterByBoolMask = List.FilterByBoolMask(list=flatten, mask=lt)
flatten_3 = Flatten(filterByBoolMask.in)
doesIntersect = Geometry.DoesIntersect(geometry=flatten_3, other=geometry, lacing=Longest)
filterByBoolMask_2 = List.FilterByBoolMask(list=filterByBoolMask.in, mask=doesIntersect)
identity = Object.Identity(filterByBoolMask_2.out)
count = List.Count(identity)
convert_between_units = DynamoConvert(count, conversionMetric=Area, conversionFrom=SquareCentimeter, conversionTo=SquareMeter)
watch_3d = Watch3D(identity)
