# Dynamo graph Structural Framing Opening for Ductswork.dyn (Dynamo 0.9.2.4472)

# group: Get the intersection points
# note: (C) Copyright 2016-2017 by BIM Oasis Inc.
# Permission to use, copy, modify, and distribute this software in
# object code form for any purpose and without fee is hereby granted,
# provided that the above copyright notice appears in all copies and
# that both that copyright notice and the limited warranty and
# restricted rights notice below appear in all supporting
# documentation.
# BIM Oasis PROVIDES THIS PROGRAM "AS IS" AND WITH ALL FAULTS.
# BIM Oasis SPECIFICALLY DISCLAIMS ANY IMPLIED WARRANTY OF
# MERCHANTABILITY OR FITNESS FOR A PARTICULAR USE. BIM Oasis,INC.
# DOES NOT WARRANT THAT THE OPERATION OF THE PROGRAM WILL BE
# UNINTERRUPTED OR ERROR FREE.
categories = Categories("StructuralFraming")
# note: BIM Oasis Copyright
# For more details please visit us at:
# https://www.facebook.com/BIMOasis
all_elements_of_category = ElementsOfCategory(categories)
categories_2 = Categories("DuctCurves")
all_elements_of_category_2 = ElementsOfCategory(categories_2)
geometry = Element.Geometry(all_elements_of_category_2)
flatten = Flatten(geometry)
geometry_2 = Element.Geometry(all_elements_of_category)

location = StructuralFraming.Location(all_elements_of_category)
byGeometry = BoundingBox.ByGeometry(geometry_2)
toCuboid = BoundingBox.ToCuboid(byGeometry)
centroid = Solid.Centroid(toCuboid)
byLineAndPoint = Plane.ByLineAndPoint(location, centroid)
intersect = Geometry.Intersect(geometry=flatten, other=byLineAndPoint, lacing=CrossProduct)
transpose = List.Transpose(intersect)
flatten_2 = Flatten()
map = List.Map(list=transpose, f_x=flatten_2)
perimeterCurves = Surface.PerimeterCurves(map)
python_script = Python(IN[0]=all_elements_of_category, IN[1]=perimeterCurves)
# ---------- python_script.python (50 lines) ----------
import clr

clr.AddReference('RevitAPI')
from Autodesk.Revit.DB import *
from Autodesk.Revit.DB.Structure import *
from Autodesk.Revit.Creation import *

clr.AddReference("System")
from System.Collections.Generic import List

clr.AddReference('RevitNodes')
import Revit
clr.ImportExtensions(Revit.GeometryConversion)
clr.ImportExtensions(Revit.Elements)

clr.AddReference('RevitServices')
import RevitServices
from RevitServices.Persistence import DocumentManager
from RevitServices.Transactions import TransactionManager

import math

doc = DocumentManager.Instance.CurrentDBDocument

openings = []

beams = IN[0]
loops = IN[1]

for idx in range(0,len(beams)):
	
	#ca = curves*/
	el = doc.GetElement(ElementId(beams[idx].Id))
	
	for curves in loops[idx]:
	
		ca = CurveArray()

		for c in curves:
		
			curve1 = c.ToRevitType(True)
			ca.Append(curve1)
					
		TransactionManager.Instance.EnsureInTransaction(doc)
		opening = doc.Create.NewOpening.Overloads[Element, CurveArray, eRefFace](el, ca, eRefFace.CenterY)
		TransactionManager.Instance.TransactionTaskDone()	
				
		openings.append(ca)

OUT = openings
# ----------------------------------------
