# Dynamo custom node Transfer Filters and Overrides.dyf (Dynamo 1.0.0.1180)
# category: Revit

current = Document.Current()
activeView = Document.ActiveView(current)
view_templates = Python()
# ---------- view_templates.python (22 lines) ----------
import clr

# Import DocumentManager and TransactionManager
clr.AddReference("RevitServices")
from RevitServices.Persistence import DocumentManager

# Import RevitAPI
clr.AddReference("RevitAPI")
from Autodesk.Revit.DB import FilteredElementCollector, View

doc = DocumentManager.Instance.CurrentDBDocument
uiapp = DocumentManager.Instance.CurrentUIApplication
app = uiapp.Application

#collect all views in the model
collector = FilteredElementCollector(doc)
views = collector.OfClass(View).ToElements()

vtNames = [v.Name for v in views if v.IsTemplate]
vtIds = [v.Id for v in views if v.IsTemplate]

OUT = [vtNames, vtIds]
# ----------------------------------------
View_Template_Index = Input()
select_view_template = Python(IN[0]=view_templates, IN[1]=View_Template_Index)
# ---------- select_view_template.python (22 lines) ----------
import clr

# Import DocumentManager and TransactionManager
clr.AddReference("RevitServices")
from RevitServices.Persistence import DocumentManager

# Import RevitAPI
clr.AddReference("RevitAPI")
from Autodesk.Revit.DB import FilteredElementCollector, View, ElementId

#doc = DocumentManager.Instance.CurrentDBDocument

#eID = ElementId(IN[1])

#OUT = None

#for i in IN[0]:
#	if i[0] == eID:
#		OUT = eID
#		break
		
OUT = IN[0][1][IN[1]]
# ----------------------------------------
view_template_filters = Python(IN[0]=select_view_template)
# ---------- view_template_filters.python (20 lines) ----------
import clr

# Import DocumentManager and TransactionManager
clr.AddReference("RevitServices")
from RevitServices.Persistence import DocumentManager

# Import RevitAPI
clr.AddReference("RevitAPI")
from Autodesk.Revit.DB import FilteredElementCollector, View, ElementId

doc = DocumentManager.Instance.CurrentDBDocument

ele = doc.GetElement(IN[0])

fEle = [doc.GetElement(f) for f in ele.GetFilters()]

fName = [f.Name for f in fEle]
fId = [f.Id for f in fEle]

OUT = [fName, fId]
# ----------------------------------------
Filter_Indices = Input()
select_filter = Python(IN[0]=view_template_filters, IN[1]=Filter_Indices)
# ---------- select_filter.python (27 lines) ----------
import clr

# Import DocumentManager and TransactionManager
clr.AddReference("RevitServices")
from RevitServices.Persistence import DocumentManager

# Import RevitAPI
clr.AddReference("RevitAPI")
from Autodesk.Revit.DB import FilteredElementCollector, View, ElementId

doc = DocumentManager.Instance.CurrentDBDocument

#eID = ElementId(IN[1])

#eID = [ElementId(i) for i in IN[1]]

#OUT = [e for i in IN[0] for e in eID if i[0] == e]
fIds = [IN[0][1][i] for i in IN[1]]

fNames = [IN[0][0][i] for i in IN[1]]

OUT = [fNames, fIds]

#for i in IN[0]:
#	if i[0] == eID:
#		OUT = eID
#		break
# ----------------------------------------
view_template_overrides = Python(IN[0]=select_view_template, IN[1]=select_filter)
# ---------- view_template_overrides.python (19 lines) ----------
import clr

# Import DocumentManager and TransactionManager
clr.AddReference("RevitServices")
from RevitServices.Persistence import DocumentManager

# Import RevitAPI
clr.AddReference("RevitAPI")
from Autodesk.Revit.DB import FilteredElementCollector, View, ElementId

doc = DocumentManager.Instance.CurrentDBDocument

# Get the view template
vt = doc.GetElement(IN[0])

# Get the filter if it is in the VT
fo = [vt.GetFilterOverrides(f) for f in IN[1][1]]

OUT = fo
# ----------------------------------------
Do_Filter_Transfer = Input()  # "Do Filter Transfer?"
add_filter_and_overrides = Python(IN[0]=activeView, IN[1]=select_filter, IN[2]=view_template_overrides, IN[3]=Do_Filter_Transfer)
# ---------- add_filter_and_overrides.python (36 lines) ----------
import clr

# Import DocumentManager and TransactionManager
clr.AddReference("RevitServices")
from RevitServices.Persistence import DocumentManager
from RevitServices.Transactions import TransactionManager

# Import RevitAPI
clr.AddReference("RevitAPI")
from Autodesk.Revit.DB import FilteredElementCollector, View, ElementId, ViewDetailLevel

if IN[3]:
	doc = DocumentManager.Instance.CurrentDBDocument
	
	# Set the view to add filter to
	v = UnwrapElement(IN[0])
	
	# Get the view template
	vt = doc.GetElement(v.ViewTemplateId)
	
	# Get the filter to add
	fId = IN[1][1]
	
	# Get overrides to apply
	ov = [UnwrapElement(o) for o in IN[2]]
	
	TransactionManager.Instance.EnsureInTransaction(doc)
	
	for f, o in zip(fId, ov):
		# Add the filter and apply the overrides
		vt.AddFilter(f)
		
		# Set the overrides
		vt.SetFilterOverrides(f, o)

	TransactionManager.Instance.TransactionTaskDone()
# ----------------------------------------
firstItem = List.FirstItem(view_templates)
getItemAtIndex = List.GetItemAtIndex(list=firstItem, index=View_Template_Index)
firstItem_2 = List.FirstItem(view_template_filters)
firstItem_3 = List.FirstItem(select_filter)

# group: Outputs
Available_View_Templates = Output(firstItem)
Selected_View_Template = Output(getItemAtIndex)
Available_Filters = Output(firstItem_2)
Selected_Filters = Output(firstItem_3)
