# Dynamo custom node All Directory Contents of Specific Filetype.dyf (Dynamo 0.8.2.2371)
# category: Bakery.Standalone

dir = Input(dir : string)
contentsAll = Custom[Directory.ContentsAll](dir=dir)  # Unlike the built-in node Directory.Contents, this node browses a directory recursively and returns all relevant files contained in subfolders as well.
watch = Watch(contentsAll)
file_extension_string_like_txt = Input()  # "file extension string like .txt"
endsWith = String.EndsWith(watch, file_extension_string_like_txt)
filterByBoolMask = List.FilterByBoolMask(list=watch, mask=endsWith)
files_found = Output(filterByBoolMask.in)
