# Dynamo custom node Always Give Point List of Length.dyf (Dynamo 0.9.2.4472)
# category: Bakery.Geometry

Originaldata = Input(Originaldata : var[]..[])
turnIntoList = Custom[TurnIntoList](unknownItem=Originaldata)  # Turns an element (or a nested list) into a flat list
flatten = Flatten(turnIntoList)
isEmpty = List.IsEmpty(flatten)
code_block = CodeBlock { 0; }
desiredLength = Input(desiredLength : int)

# group: backup plan if no room point
byCoordinates = Point.ByCoordinates(x=code_block, y=code_block, z=code_block)

watch = Watch(byCoordinates)
turnIntoList_2 = Custom[TurnIntoList](unknownItem=watch)

# group (continued): backup plan if no room point
cycle = List.Cycle(list=turnIntoList_2, amount=desiredLength)
switch = Custom[Switch](boolean_switch=isEmpty, data=cycle)

watch_2 = Watch(switch)

# group: room is found
boolean = BoolSelector(false)
eq = isEmpty == boolean
switch_2 = Custom[Switch](boolean_switch=eq, data=turnIntoList)

watch_3 = Watch(switch_2)
cycle_2 = List.Cycle(list=watch_3, amount=desiredLength)

# group: get the accepted points
create = List.Create(switch, cycle_2)
flatten_2 = Flatten(create)

chop = List.Chop(list=flatten_2, lengths=desiredLength)
firstItem = List.FirstItem(chop)
pointList = Output(firstItem)
