# Dynamo custom node Any Null in List.dyf (Dynamo 0.9.2.4472)
# category: Bakery.Functions
# returns boolean true if a null is found

list = Input(list : var[]..[])
code_block = CodeBlock { null; }
bv_all_indices_of_that_can = Custom[bv All Indices Of that can handle Nulls](list=list, value=code_block)  # forked from spring nodes
count = Count(bv_all_indices_of_that_can)
code_block_2 = CodeBlock { 1; }
ge = count >= code_block_2
bool = Output(ge)
