# Dynamo custom node Boolean to Int.dyf (Dynamo 0.9.2.4472)
# category: Bakery.Functions
# 0 false, 1 true

code_block = CodeBlock { false; }
code_block_2 = CodeBlock { true; }
create = List.Create(code_block, code_block_2)
item = Input(item : var)
firstIndexOf = List.FirstIndexOf(list=create, item=item)
int = Output(firstIndexOf)
