# Dynamo custom node Circle Sweep along NURBS path with smoothing.dyf (Dynamo 0.8.2.2371)
# category: Bakery.Geometry

nurbs_curve = Input()
code_block = CodeBlock { 10; }
zero_to_one_range_with_divisor = Custom[Zero to One Range with Divisor](divisor=code_block)
pointAtParameter = Curve.PointAtParameter(curve=nurbs_curve, param=zero_to_one_range_with_divisor)
code_block_2 = CodeBlock { 10; }
byControlPoints = NurbsCurve.ByControlPoints(pointAtParameter, code_block_2)
resolution = Input()
zero_to_one_range_with_divisor_2 = Custom[Zero to One Range with Divisor](divisor=resolution)
planeAtParameter = Curve.PlaneAtParameter(curve=byControlPoints, param=zero_to_one_range_with_divisor_2)
radius = Input(radius : double)
byPlaneRadius = Circle.ByPlaneRadius(plane=planeAtParameter, radius=radius)
code_block_3 = CodeBlock { 3; }
zero_to_one_range_with_divisor_3 = Custom[Zero to One Range with Divisor](divisor=code_block_3)
pointAtParameter_2 = Curve.PointAtParameter(param=zero_to_one_range_with_divisor_3)
map = List.Map(list=byPlaneRadius, f_x=pointAtParameter_2)
code_block_4 = CodeBlock { 3; }
byPoints = NurbsSurface.ByPoints(map, code_block_4, code_block_4)
NurbsSurface = Output(byPoints)
firstItem = List.FirstItem(byPlaneRadius)
lastItem = List.LastItem(byPlaneRadius)
create = List.Create(firstItem, lastItem)
byLoft = Solid.ByLoft(create)
simplified_loft = Output(byLoft)
code_block_5 = CodeBlock { 3; }
zero_to_one_range_with_divisor_4 = Custom[Zero to One Range with Divisor](divisor=code_block_5)
pointAtParameter_3 = Curve.PointAtParameter(param=zero_to_one_range_with_divisor_4)
map_2 = List.Map(list=create, f_x=pointAtParameter_3)
code_block_6 = CodeBlock { 3; }
byPoints_2 = NurbsSurface.ByPoints(map_2, code_block_6, code_block_6)
simplified_NurbsSurface = Output(byPoints_2)
