# Dynamo custom node Clean Solid List by using Simplified Form as Replacement.dyf (Dynamo 0.8.2.2371)
# category: Bakery.Geometry

solid_list = Input()
watch = Watch(solid_list)
code_block = CodeBlock { null; }
bv_all_indices_of_that_can = Custom[bv All Indices Of that can handle Nulls](list=watch, value=code_block)  # forked from spring nodes
circle_profiles_list = Input()
watch_2 = Watch(circle_profiles_list)
getItemAtIndex = List.GetItemAtIndex(list=watch_2, index=bv_all_indices_of_that_can)
solid_loft_using_first_and_last = Custom[Solid Loft using First and Last Cross section]()
map = List.Map(list=getItemAtIndex, f_x=solid_loft_using_first_and_last)
replaceItemAtIndex = Custom[List.ReplaceItemAtIndex](seq=watch, index=bv_all_indices_of_that_can, replacement=map)  # Replaces the item at a given index (or list of indices) of a list by another item
cleaned_solid_list = Output(replaceItemAtIndex)
