# Dynamo custom node Clean Warning Types from Error Report HTML.dyf (Dynamo 0.8.2.2392)
# category: Bakery.Standalone
# working with error report html parsing

warningRowList = Input()
count = List.Count()
map = List.Map(list=warningRowList, f_x=count)
watch = Watch(map)
code_block = CodeBlock { 1; }
gt = watch > code_block
watch_2 = Watch(gt)
filterByBoolMask = List.FilterByBoolMask(mask=watch_2)
watch_3 = Watch(filterByBoolMask.in)
number_slider = DoubleSlider(1, range=0..100 step 0.1)
getItemAtIndex = List.GetItemAtIndex(index=number_slider)
map_2 = List.Map(list=filterByBoolMask.in, f_x=getItemAtIndex)
watch_4 = Watch(map_2)
number_slider_2 = DoubleSlider(0, range=0..100 step 0.1)
getItemAtIndex_2 = List.GetItemAtIndex(index=number_slider_2)
map_3 = List.Map(list=filterByBoolMask.out, f_x=getItemAtIndex_2)
create = List.Create(map_2, map_3)
flatten = Flatten(create)
uniqueItems = List.UniqueItems(flatten)
Unique_Warning_Types_cleaned = Output(uniqueItems)
