# Dynamo custom node Collect All Elements in Model.dyf (Dynamo 0.9.1.4062)
# category: Bakery.Collect
# uses a nested catch-all, then a refined selection by category

built_in_name_lister = Custom[Built In Name Lister]()  # for document
does_this_document_contain = Custom[Does this Document Contain Category](builtInNames=built_in_name_lister.builtins)
Categories = Output(does_this_document_contain.CategoryList)
select_elements_using_builtin = Custom[Select Elements Using BuiltIn Category Names](builtIns=built_in_name_lister.builtins)  # works on a list of BuiltIn Names
elements = Output(select_elements_using_builtin)
count = List.Count(select_elements_using_builtin)
count_2 = Output(count)  # "count"
