# Dynamo custom node Comma Separated Point Value to Point Object.dyf (Dynamo 0.8.2.2371)
# category: Bakery.Geometry

obj = Input()
turnIntoList = Custom[TurnIntoList](obj)  # Turns an element (or a nested list) into a flat list
string_from_object = FromObject(turnIntoList)
remove_first_and_last_characters = Custom[Remove First and Last Characters from String](stringIn=string_from_object)
string = StringInput(", ")
split = String.Split(remove_first_and_last_characters, string)
watch = Watch(split)
code_block = CodeBlock { 0; }
getItemAtIndex = List.GetItemAtIndex(index=code_block)
map = List.Map(list=watch, f_x=getItemAtIndex)
watch_2 = Watch(map)
toNumber = String.ToNumber(watch_2)
scale = Input()
code_block_2 = CodeBlock(x=toNumber, y=scale) { x/y; }
code_block_3 = CodeBlock { 1; }
getItemAtIndex_2 = List.GetItemAtIndex(index=code_block_3)
map_2 = List.Map(list=watch, f_x=getItemAtIndex_2)
watch_3 = Watch(map_2)
toNumber_2 = String.ToNumber(watch_3)
code_block_4 = CodeBlock(x=toNumber_2, y=scale) { x/y; }
code_block_5 = CodeBlock { 2; }
getItemAtIndex_3 = List.GetItemAtIndex(index=code_block_5)
map_3 = List.Map(list=watch, f_x=getItemAtIndex_3)
watch_4 = Watch(map_3)
toNumber_3 = String.ToNumber(watch_4)
code_block_6 = CodeBlock(x=toNumber_3, y=scale) { x/y; }
byCoordinates = Point.ByCoordinates(x=code_block_2, y=code_block_4, z=code_block_6)
Point = Output(byCoordinates)
