# Dynamo custom node Comma Separated Revit Data to XYZ Values.dyf (Dynamo 0.8.2.2371)
# category: Bakery.Geometry

item = Input()
string_from_object = FromObject(item)
remove_first_and_last_characters = Custom[Remove First and Last Characters from String](stringIn=string_from_object)
string = StringInput(", ")
split = String.Split(remove_first_and_last_characters, string)
watch = Watch(split)
code_block = CodeBlock { 0; }
getItemAtIndex = List.GetItemAtIndex(list=watch, index=code_block)
watch_2 = Watch(getItemAtIndex)
toNumber = String.ToNumber(watch_2)
X = Output(toNumber)
code_block_2 = CodeBlock { 1; }
getItemAtIndex_2 = List.GetItemAtIndex(list=watch, index=code_block_2)
watch_3 = Watch(getItemAtIndex_2)
toNumber_2 = String.ToNumber(watch_3)
Y = Output(toNumber_2)
code_block_3 = CodeBlock { 2; }
getItemAtIndex_3 = List.GetItemAtIndex(list=watch, index=code_block_3)
watch_4 = Watch(getItemAtIndex_3)
toNumber_3 = String.ToNumber(watch_4)
Z = Output(toNumber_3)
