# Dynamo custom node Compare Contents of Two Directories.dyf (Dynamo 0.9.1.4062)
# category: Bakery.Standalone

dirOne = Input(dirOne : string)
file_extension_like_txt = Input()  # "file extension like .txt"
all_directory_contents_of = Custom[All Directory Contents of Specific Filetype](dir=dirOne, file_extension_string_like_txt=file_extension_like_txt)
fileName = FilePath.FileName(all_directory_contents_of)
dirTwo = Input(dirTwo : string)
all_directory_contents_of_2 = Custom[All Directory Contents of Specific Filetype](dir=dirTwo, file_extension_string_like_txt=file_extension_like_txt)
fileName_2 = FilePath.FileName(all_directory_contents_of_2)
compare_two_lists_by_item_and = Custom[Compare Two Lists by Item and Return Item Differences](listONE=fileName, listTWO=fileName_2)
in_dirTwo_but_not_in_dirOne = Output(compare_two_lists_by_item_and.inListTWObutNotInListOne)
in_dirOne_but_not_in_dirTwo = Output(compare_two_lists_by_item_and.inListONEbutNotInListTwo)
operations = Custom[List.Operations](List_A=fileName, List_B=fileName_2)  # List A-B / List Intersection / List symmetric difference
watch = Watch(operations.Intersection)
sort = List.Sort(watch)
in_both = Output(sort)
