# Dynamo custom node Copy File List to New Directory.dyf (Dynamo 0.9.1.4062)
# category: Bakery.Standalone
# takes list of file paths and a Directory Path

fileList = Input()
watch = Watch(fileList)
count = Count(watch)
code_block = CodeBlock(x=count) { 0..(x-1); }
TargetDirectoryPath = Input()
subnode_to_copy_one_file_to_new = Custom[subnode to Copy One File to New Directory](filepathlist=watch, directoryWithoutEndSlash=TargetDirectoryPath)
map = List.Map(list=code_block, f_x=subnode_to_copy_one_file_to_new)
unhelpfulOutput = Output(map)
wait = Custom[Input.Wait](WaitForMe=map, Output=TargetDirectoryPath)  # Waits for all inputs to be completed before continuing the execution process.Part of the SmartCopyMon workflow.
contentsAll = Custom[Directory.ContentsAll](dir=wait)  # Unlike the built-in node Directory.Contents, this node browses a directory recursively and returns all relevant files contained in subfolders as well.
targetDirContents = Output(contentsAll)
