# Dynamo custom node Curve to Point based Nurbs Curve.dyf (Dynamo 0.8.2.2371)
# category: Bakery.Geometry

curve = Input()
divisor = Input(divisor : var[]..[])
zero_to_one_range_with_divisor = Custom[Zero to One Range with Divisor](divisor=divisor)
pointAtParameter = Curve.PointAtParameter(curve=curve, param=zero_to_one_range_with_divisor)
byControlPoints = NurbsCurve.ByControlPoints(pointAtParameter)
NurbsCurve = Output(byControlPoints)
byPoints = NurbsCurve.ByPoints(pointAtParameter)
NurbsCurve_Bspline = Output(byPoints)
