# Dynamo custom node Curves to Circle Lofted Solids.dyf (Dynamo 0.8.2.2392)
# category: Bakery.Geometry

curve = Input()
divisor = Input(divisor : var[]..[])
zero_to_one_range_with_divisor = Custom[Zero to One Range with Divisor](divisor=divisor)
planeAtParameter = Curve.PlaneAtParameter(curve=curve, param=zero_to_one_range_with_divisor, lacing=Longest)
radius = Input(radius : double)
byPlaneRadius = Circle.ByPlaneRadius(plane=planeAtParameter, radius=radius, lacing=Longest)
byLoft = Solid.ByLoft(byPlaneRadius)
Solid = Output(byLoft)
watch = Watch(byPlaneRadius)
circles = Output(watch)
byLoft_2 = PolySurface.ByLoft(byPlaneRadius)
Polysurface = Output(byLoft_2)
