# Dynamo custom node Does this Document Contain Category.dyf (Dynamo 0.8.1.1942)
# category: Bakery.Categories
# This iterates all BuiltInNames searching for elements on those categories. output CategoryList shows categories in this document.

builtInNames = Input()
select_based_on_a_single_builtin = Custom[Select based on a single builtin name]()  # asdf
map = List.Map(list=builtInNames, f_x=select_based_on_a_single_builtin)
firstItem = List.FirstItem()
map_2 = List.Map(list=map, f_x=firstItem)
firstItem_2 = List.FirstItem()
map_3 = List.Map(list=map_2, f_x=firstItem_2)
flatten = Flatten(map_3)
sampleSet = Output(flatten)
code_block = CodeBlock { false; }
clean = List.Clean(list=map_3, preserveIndices=code_block)
code_block_2 = CodeBlock { "Category"; }
code_block_3 = CodeBlock { "---null---"; }
bruteforce_get_parameter_via = Custom[Bruteforce Get Parameter via String Split V2](parameterName=code_block_2, replaceEmptyWithString=code_block_3)  # BETTER
map_4 = List.Map(list=clean, f_x=bruteforce_get_parameter_via)
flatten_2 = Flatten(map_4)
uniqueItems = List.UniqueItems(flatten_2)
code_block_4 = CodeBlock { "None"; }
create = List.Create(code_block_4)
removeItemsFromOtherList = Custom[List.RemoveItemsFromOtherList](List_A=uniqueItems, List_B=create)  # This will take long list A, remove entries that appear in short list B, and give you list C. (JBE List Operations are probably more robust).
sort = List.Sort(removeItemsFromOtherList)
CategoryList = Output(sort)
watch = Watch(clean)
watch_2 = Watch(map_4)
