# Dynamo custom node Draw Revit Model Lines From Point.dyf (Dynamo 0.8.2.2371)
# category: Bakery.Geometry
# places model lines from a point to show its location in Revit

point = Input(point : Point)
deconstructPoint = Geometry.Points.DeconstructPoint(point)
code_block = CodeBlock(x=deconstructPoint.out2) { x+1000; }
byCoordinates = Point.ByCoordinates(x=deconstructPoint.out0, y=deconstructPoint.out1, z=code_block)
byStartPointEndPoint = Line.ByStartPointEndPoint(startPoint=point, endPoint=byCoordinates)
code_block_2 = CodeBlock { 300; }
byCenterPointRadius = Circle.ByCenterPointRadius(centerPoint=byCoordinates, radius=code_block_2)
code_block_3 = CodeBlock { {0,0.33,0.66}; }
pointAtParameter = Curve.PointAtParameter(curve=byCenterPointRadius, param=code_block_3, lacing=Longest)
byStartPointEndPoint_2 = Line.ByStartPointEndPoint(startPoint=point, endPoint=pointAtParameter, lacing=Longest)
create = List.Create(byStartPointEndPoint, byStartPointEndPoint_2, byCenterPointRadius)
flatten = Flatten(create)
byCurve = ModelCurve.ByCurve(flatten)
ModelCurve = Output(byCurve)
