# Dynamo custom node Element Name Universal.dyf (Dynamo 0.8.1.1942)
# category: Bakery.Elements
# Modified for 0.8.1

Element_s = Input()  # "Element(s)"
turn_into_list = Custom[Turn Into List](item=Element_s)  # Turns an element (or a nested list) into a flat list
python_script = Python(IN[0]=turn_into_list)
# ---------- python_script.python (12 lines) ----------
import clr
clr.AddReference('RevitAPI')
from Autodesk.Revit.DB import *

faminsts = UnwrapElement(IN[0])
elementlist = list()
for item in faminsts:
	try:
		elementlist.append(item.Name)
	except:
		elementlist.append(list())
OUT = elementlist
# ----------------------------------------
Name_s = Output(python_script)  # "Name(s)"
