# Dynamo custom node File List from File Path showing Files in SubDirs.dyf (Dynamo 0.8.1.1942)
# category: Bakery.Standalone

DirectoryPath = Input()
fromPath = DirectoryObject(DirectoryPath)  # "Directory.FromPath"
contents = Directory.Contents(fromPath)
fileList = Output(contents.out0)
directoryList = Output(contents.out1)
