# Dynamo custom node File List from File Path.dyf (Dynamo 0.8.2.2371)
# category: Bakery.Standalone

DirectoryPath = Input()
fromPath = DirectoryObject(DirectoryPath)  # "Directory.FromPath"
contents = Directory.Contents(fromPath)
fileList = Output(contents)
string = StringInput("\")
split = String.Split(contents, string)
lastItem = List.LastItem()
map = List.Map(list=split, f_x=lastItem)
filesOnly = Output(map)
