# Dynamo custom node File Path from Directory and String.dyf (Dynamo 0.9.2.4472)
# category: Bakery.Standalone

string = StringInput("")
directoryPath = Input()
string_from_object = FromObject(directoryPath)
string_2 = StringInput("\")
fileName = Input()
fileExtension = Input()
join = String.Join(string, string_from_object, string_2, fileName, fileExtension)
str = Output(join)
