# Dynamo custom node File Size in MB from File Path.dyf (Dynamo 0.8.0.950)
# category: Bakery.Standalone
# Input a File Path node, and this will do a ReadText to calculate approximate, rounded file size in MB. Also reports the string length if you want more granularity.

FilePath = Input()
fromPath = FileObject(FilePath)  # "File.FromPath"
readText = File.ReadText(fromPath)
length = String.Length(readText)
number = DoubleInput(967)
div = length / number
number_2 = DoubleInput(1000)
div_2 = div / number_2
round = Math.Round(div_2)
Size_in_MB = Output(round)
File_ReadText_Length = Output(length)
