# Dynamo custom node Find Nearest Revit Level for a Given Z value.dyf (Dynamo 0.8.2.2371)
# category: Bakery.Geometry

categories = Categories("Levels")
all_elements_of_category = ElementsOfCategory(categories)
z_value = Input()
elevation = Level.Elevation(all_elements_of_category)
list_of_float_double_to_list_of = Custom[List of float double to list of Int](double=elevation)  # no decimals
sub = z_value - list_of_float_double_to_list_of
formula = Formula("abs(x)", x=sub)
minimumItem = List.MinimumItem(formula)
if_equal_return_index_using = Custom[If Equal Return Index using IndexOf](searchForThese=minimumItem, inThisList=formula)
getItemAtIndex = List.GetItemAtIndex(list=all_elements_of_category, index=if_equal_return_index_using)
nearestLevel = Output(getItemAtIndex)
