# Dynamo custom node Get Boundary Curves from Room List.dyf (Dynamo 0.8.2.2371)
# category: Bakery.Geometry
# use this one

rooms = Input()
watch = Watch(rooms)
get_boundary_curve_for_one_room = Custom[Get Boundary Curve for One Room by Perimeter]()
map = List.Map(list=watch, f_x=get_boundary_curve_for_one_room)
flatten = Flatten(map)
get_indices_of_null_values = Custom[Get Indices of Null Values](list=flatten)
getItemAtIndex = List.GetItemAtIndex(list=watch, index=get_indices_of_null_values)
failed = Output(getItemAtIndex)
removeItemAtIndex = List.RemoveItemAtIndex(list=flatten, indices=get_indices_of_null_values)
flatten_2 = Flatten(removeItemAtIndex)
boundaryCurves = Output(flatten_2)
allCurves = Output(flatten)
failureIndices = Output(get_indices_of_null_values)
