# Dynamo custom node Get Build Number and Worksharing from RVT file.dyf (Dynamo 0.8.0.706)
# category: Bakery.Standalone
# uses read.text and string split methods, from Marcello

string = StringInput("---Build Number---")
string_2 = StringInput("\0")
File_Path = Input()
fromPath = FileObject(File_Path)  # "File.FromPath"
readText = File.ReadText(fromPath)
code_block = CodeBlock { "\0R\0e\0v\0i\0t\0 \0B\0u\0i\0l\0d\0:\0 "; }
code_block_2 = CodeBlock { "\0L\0a\0s\0t\0 \0S\0a\0v\0e\0 \0P\0a\0t\0h\0"; }
split = String.Split(readText, code_block, code_block_2)
code_block_3 = CodeBlock(x=split) { x[1]; }
turn_into_list = Custom[Turn Into List](item=code_block_3)  # Turns an element (or a nested list) into a flat list
string_from_object = FromObject(turn_into_list)
flatten = Flatten(string_from_object)
string_3 = StringInput("")
replaceRegularExpression = Custom[String.ReplaceRegularExpression](regex=string_2, string_s=flatten, replacement=string_3)  # Replaces all occurences of a regular expression within a given string (or list of strings) with another string. The syntax for regular expressions is explained at http://ironpython-test.readthedocs.org/en/latest/howto/regex.html
string_4 = StringInput("---Worksharing Status---")
string_5 = StringInput("\0")
code_block_4 = CodeBlock { "W\0o\0r\0k\0s\0h\0a\0r\0i\0n\0g"; }
code_block_5 = CodeBlock { "U\0s\0e\0r\0n\0a\0m\0e"; }
split_2 = String.Split(readText, code_block_4, code_block_5)
code_block_6 = CodeBlock(x=split_2) { x[1]; }
string_from_object_2 = FromObject(code_block_6)
number_slider = DoubleSlider(1, range=0..100 step 0.1)
number_slider_2 = DoubleSlider(2, range=0..100 step 0.1)
remove = String.Remove(str=string_from_object_2, startIndex=number_slider, count=number_slider_2)
create = List.Create(remove)
flat_list_to_list_of_strings = Custom[Flat List to List of Strings](Original_List=create)  # using python methods
number_slider_3 = DoubleSlider(0, range=0..100 step 0.1)
number_slider_4 = DoubleSlider(2, range=0..100 step 0.1)
remove_2 = String.Remove(str=flat_list_to_list_of_strings, startIndex=number_slider_3, count=number_slider_4)
firstItem = List.FirstItem(remove_2)
turn_into_list_2 = Custom[Turn Into List](item=firstItem)
string_from_object_3 = FromObject(turn_into_list_2)
flatten_2 = Flatten(string_from_object_3)
string_6 = StringInput("")
replaceRegularExpression_2 = Custom[String.ReplaceRegularExpression](regex=string_5, string_s=flatten_2, replacement=string_6)
create_2 = List.Create(string, replaceRegularExpression, string_4, replaceRegularExpression_2)
flatten_3 = Flatten(create_2)
Flat_list_of_info = Output(flatten_3)
