# Dynamo custom node Get Build Number from All RVTs in a Folder.dyf (Dynamo 0.8.1.1942)
# category: Bakery.Standalone

directoryPath = Input()
file_list_from_file_path = Custom[File List from File Path](DirectoryPath=directoryPath)
fromPath = FileObject(file_list_from_file_path)  # "File.FromPath"
from_file_path_into_rvt_build = Custom[From File Path into RVT Build Information]()
map = List.Map(list=fromPath, f_x=from_file_path_into_rvt_build)
output = Output(map)
