# Dynamo custom node Get Connector.CoordinateSystem.dyf (Dynamo 1.0.0.1180)
# category: Bakery.MEP

connectors = Input()
turnIntoList = Custom[TurnIntoList](unknownItem=connectors)  # Turns an element (or a nested list) into a flat list
python_script = Python(IN[0]=turnIntoList)
# ---------- python_script.python (38 lines) ----------
#Created by Luke Johnson for Bakery
import clr
clr.AddReference('ProtoGeometry')
from Autodesk.DesignScript.Geometry import *

# Import ToDSType(bool) extension method
clr.AddReference("RevitNodes")
import Revit
clr.ImportExtensions(Revit.Elements)

# Import DocumentManager and TransactionManager
clr.AddReference("RevitServices")
import RevitServices
from RevitServices.Persistence import DocumentManager
from RevitServices.Transactions import TransactionManager


from System.Collections.Generic import *

# Import RevitAPI
clr.AddReference("RevitAPI")
import Autodesk

doc = DocumentManager.Instance.CurrentDBDocument
uiapp = DocumentManager.Instance.CurrentUIApplication
app = uiapp.Application

#The inputs to this node will be stored as a list in the IN variable.
ctrayelems = UnwrapElement(IN[0])

#curvenrmls = []
cnctcs = []

for y in ctrayelems:
#	curvenrmls.append(y.CurveNormal)
	cnctcs.append(y.CoordinateSystem)
#Assign your output to the OUT variable
OUT = cnctcs
# ----------------------------------------
revitCoordinateSystems = Output(python_script)
