# Dynamo custom node Get Date Modified From File Path List.dyf (Dynamo 0.8.2.2371)
# category: Bakery.Standalone
# list of paths to files

filePathList = Input()
python_script = Python(IN[0]=filePathList)
# ---------- python_script.python (22 lines) ----------
import clr
import sys
sys.path.append("C:\Program Files (x86)\IronPython 2.7\Lib")
import os
import datetime
clr.AddReference('ProtoGeometry')
from Autodesk.DesignScript.Geometry import *
#The inputs to this node will be stored as a list in the IN variables.

def modification_date(filename):
    t = os.path.getmtime(filename)
    return datetime.datetime.fromtimestamp(t)

dataEnteringNode = IN[0]
dlist = []
for d in dataEnteringNode:
	try:
		dlist.append(modification_date(d))
	except:
		dlist.append("failed")
#Assign your output to the OUT variable.
OUT = dlist
# ----------------------------------------
datesModified = Output(python_script)
