# Dynamo custom node Get Family and Type List for Project.dyf (Dynamo 0.8.2.2392)
# category: Bakery.Families

# group: Grab Types
get_family_list_for_this_project = Custom[Get Family List for this project]()
symbols = Family.Symbols(get_family_list_for_this_project)

# group: Make Unique Id
flatten = Flatten(symbols)
family = FamilySymbol.Family(flatten)
name = Element.Name(family)
name_2 = Element.Name(flatten)
create = List.Create(name, name_2)
transpose = List.Transpose(create)
code_block = CodeBlock { "---"; }

watch = Watch(flatten)
Type_List = Output(watch)
bv_merge_sublists_with_a = Custom[bv Merge Sublists with a separator](List=transpose, Character=code_block)  # forked from Rhythm
watch_2 = Watch(bv_merge_sublists_with_a)
Family_Type_string = Output(watch_2)  # "Family---Type string"
Family_List = Output(family)
