# Dynamo custom node Get File Sizes from File Path List.dyf (Dynamo 0.8.2.2371)
# category: Bakery.Standalone

filePathList = Input()
python_script = Python(IN[0]=filePathList)
# ---------- python_script.python (22 lines) ----------
import clr
import sys
sys.path.append("C:\Program Files (x86)\IronPython 2.7\Lib")
import os
import datetime
clr.AddReference('ProtoGeometry')
from Autodesk.DesignScript.Geometry import *
#The inputs to this node will be stored as a list in the IN variables.

def file_sizes(filename):
    t = os.stat(filename).st_size
    return t

dataEnteringNode = IN[0]
dlist = []
for d in dataEnteringNode:
	try:
		dlist.append(file_sizes(d))
	except:
		dlist.append("failed")
#Assign your output to the OUT variable.
OUT = dlist
# ----------------------------------------
fileSizesInBytes = Output(python_script)
string_from_object = FromObject(python_script)
toNumber = String.ToNumber(string_from_object)
code_block = CodeBlock(x=toNumber) { x/(1024*1024); }
fileSizesInMB = Output(code_block)
