# Dynamo custom node Get Room Geometry and Filter by Level Elevation.dyf (Dynamo 0.8.2.2392)
# category: Bakery.Geometry

one_Room = Input()
watch = Watch(one_Room)
geometry = Element.Geometry(watch)
code_block = CodeBlock { 0; }
getItemAtIndex = List.GetItemAtIndex(index=code_block)
map = List.Map(list=geometry, f_x=getItemAtIndex)
faces = Topology.Faces(map)
firstItem = List.FirstItem(faces)
level = Custom[Element.Level](Element_s=watch)  # Gets an element's level
elevation = Level.Elevation(level)
vertices = Topology.Vertices(faces)
pointGeometry = Vertex.PointGeometry(vertices)
deconstructPoint = Geometry.Points.DeconstructPoint(pointGeometry)
watch_2 = Watch(deconstructPoint.out2)
eq = elevation == watch_2  # lacing=Longest
firstItem_2 = List.FirstItem(eq)
allTrue = AllTrue()
map_2 = List.Map(list=firstItem_2, f_x=allTrue)
code_block_2 = CodeBlock { true; }
indexOf = IndexOf(map_2, code_block_2)
getItemAtIndex_2 = List.GetItemAtIndex(list=firstItem, index=indexOf)
face = Output(getItemAtIndex_2)
