# Dynamo custom node Get This Dynamo Version.dyf (Dynamo 0.8.2.2371)
# category: Bakery.Standalone

python_script = Python()
# ---------- python_script.python (6 lines) ----------
import clr
clr.AddReference('ProtoGeometry')
from Autodesk.DesignScript.Geometry import *
import System

OUT = System.Diagnostics.Process.GetCurrentProcess().MainModule.FileVersionInfo.FileVersion
# ----------------------------------------
version = Output(python_script)
