# Dynamo custom node GetElementsContaining-LSJ.dyf "GetElementsContaining" (Dynamo 0.7.1.17276)
# category: LSJ
# This node search the selected element type for a inputvalue(string) and returns a list of the elements containing the given input.

Element_Types = Input()
all_elements_of_type = ElementsOfType(Element_Types)
toString = ToString()
map = List.Map(all_elements_of_type, toString)
Search_for_Case_ignored = Input()  # "Search for (Case ignored)"
boolean = BoolSelector(true)
contains = String.Contains(arg1=Search_for_Case_ignored, arg2=boolean)
map_2 = List.Map(map, contains)
filterByBoolMask = List.FilterByBoolMask(all_elements_of_type, map_2)
list = Output(filterByBoolMask)
