# Dynamo custom node List Nodes in DYFs for an Entire Folder.dyf (Dynamo 0.8.0.950)
# category: Bakery.Standalone
# takes Directory Path as input node

Directory_Path = Input()
fromPath = DirectoryObject(Directory_Path)  # "Directory.FromPath"
contents = Directory.Contents(fromPath)
show_dependency_nodes_for_one = Custom[Show Dependency Nodes for one DYF]()  # used with List.Map for a folder of them
map = List.Map(list=contents, f_x=show_dependency_nodes_for_one)
mappedResult = Output(map)
fileList = Output(contents)
