# Dynamo custom node List of Curves to Circle Lofted Solids.dyf (Dynamo 0.8.2.2371)
# category: Bakery.Geometry
# also returns circle lists

divisor = Input()
counter = Input()
getItemAtIndex = List.GetItemAtIndex(list=divisor, index=counter)
list_of_curves = Input()
watch = Watch(list_of_curves)
getItemAtIndex_2 = List.GetItemAtIndex(list=watch, index=counter)
circle_radius = Input()
getItemAtIndex_3 = List.GetItemAtIndex(list=circle_radius, index=counter)
curves_to_circle_lofted_solids = Custom[Curves to Circle Lofted Solids](divisor=getItemAtIndex, curve=getItemAtIndex_2, radius=getItemAtIndex_3)
solid_lists = Output(curves_to_circle_lofted_solids.Solid)
circle_lists = Output(curves_to_circle_lofted_solids.circles)
count = Count(watch)
code_block = CodeBlock(x=count) { 0..(x-1); }
