# Dynamo custom node List of Curves to Point based NURBs Curves.dyf (Dynamo 0.8.2.2371)
# category: Bakery.Geometry

list = Input()
divisor = Input(divisor : var[]..[])
curve_to_point_based_nurbs_curve = Custom[Curve to Point based Nurbs Curve](divisor=divisor)
map = List.Map(list=list, f_x=curve_to_point_based_nurbs_curve.NurbsCurve)
nurbscurves = Output(map)
map_2 = List.Map(list=list, f_x=curve_to_point_based_nurbs_curve.NurbsCurve_Bspline)
b_splines = Output(map_2)
