# Dynamo custom node Make a Banana.dyf (Dynamo 0.8.2.2371)
# category: Bakery.Geometry

firstPoint = Input(firstPoint : Point)
secondPoint = Input(secondPoint : Point)
thirdPoint = Input(thirdPoint : Point)
byThreePoints = Arc.ByThreePoints(firstPoint=firstPoint, secondPoint=secondPoint, thirdPoint=thirdPoint)
code_block = CodeBlock { {0,0.5,0.75,1}; }
pointAtParameter = Curve.PointAtParameter(curve=byThreePoints, param=code_block)
code_block_2 = CodeBlock { {0.3,1,1,0.3}; }
tangentAtParameter = Curve.TangentAtParameter(byThreePoints, code_block)
byCenterPointRadiusNormal = Circle.ByCenterPointRadiusNormal(pointAtParameter, code_block_2, tangentAtParameter)
code_block_3 = CodeBlock { 6; }
regularPolygon = Polygon.RegularPolygon(circle=byCenterPointRadiusNormal, numberSides=code_block_3)
watch = Watch(regularPolygon)
code_block_4 = CodeBlock(s=watch, t=tangentAtParameter) { s[Count(s)-1]; t[Count(t)-1]; }
code_block_5 = CodeBlock { 2; }
translate = Geometry.Translate(geometry=code_block_4.out0, direction=code_block_4.out1, distance=code_block_5)
join = List.Join(watch, translate)
byLoft = Surface.ByLoft(join)
Geom = Output(byLoft)
code_block_6 = CodeBlock()
# ---------- code_block_6.designscript (166 lines) ----------
t16 = String.Replace("219, 253, 232, 186, 244, 243, 239, 238, 234, 234, 234, 233, 239, 237, 239, 235, 235, 237, 231, 229, 229, 227, 225, 222, 219, 216, 205, 210, 218, 217, 220, 220, 228, 233, 234, 236, 240, 240, 242, 242, 247, 241, 187, 243, 254, 254, 251, 251, 252, 252
250, 252, 185, 163, 248, 243, 235, 237, 237, 235, 237, 237, 239, 239, 238, 237, 241, 236, 238, 238, 237, 243, 237, 233, 232, 230, 232, 227, 228, 231, 234, 231, 235, 241, 242, 243, 242, 244, 246, 249, 249, 240, 120, 250, 254, 251, 253, 254, 202, 253
251, 253, 172, 151, 242, 241, 194, 233, 241, 240, 240, 242, 240, 242, 243, 241, 240, 238, 242, 242, 243, 243, 244, 240, 235, 234, 238, 237, 237, 240, 240, 241, 246, 249, 242, 243, 247, 248, 249, 253, 250, 237, 154, 253, 250, 252, 251, 251, 192, 251
251, 252, 182, 151, 246, 189, 146, 164, 234, 243, 244, 244, 244, 241, 240, 241, 242, 238, 239, 244, 249, 249, 248, 246, 238, 236, 241, 241, 235, 242, 245, 248, 245, 249, 247, 245, 246, 252, 235, 253, 252, 245, 174, 253, 253, 253, 251, 241, 193, 253
251, 253, 203, 165, 245, 163, 122, 143, 230, 228, 234, 244, 240, 243, 240, 244, 244, 187, 238, 251, 252, 250, 249, 247, 227, 222, 246, 242, 185, 246, 247, 244, 248, 251, 252, 246, 247, 251, 215, 246, 251, 252, 225, 253, 253, 252, 220, 205, 227, 250
253, 250, 247, 196, 249, 141, 100, 122, 207, 189, 240, 169, 184, 247, 246, 245, 242, 154, 198, 252, 253, 251, 251, 248, 169, 171, 247, 241, 165, 250, 253, 244, 247, 253, 250, 236, 242, 251, 237, 251, 252, 254, 250, 253, 253, 249, 197, 184, 251, 253
251, 252, 253, 252, 250, 141, 110, 121, 162, 133, 232, 204, 212, 250, 251, 249, 236, 136, 167, 252, 252, 252, 253, 250, 163, 164, 249, 247, 163, 248, 251, 209, 230, 254, 253, 192, 209, 251, 251, 254, 253, 254, 253, 253, 254, 253, 201, 192, 253, 250
253, 253, 251, 251, 252, 152, 114, 136, 134, 112, 201, 148, 242, 250, 250, 251, 240, 133, 173, 253, 253, 253, 254, 251, 170, 183, 249, 250, 180, 253, 252, 177, 191, 253, 251, 169, 181, 252, 252, 253, 252, 253, 251, 226, 254, 253, 221, 192, 252, 253
253, 254, 253, 253, 252, 187, 134, 151, 136, 118, 151, 113, 243, 250, 245, 233, 242, 155, 224, 254, 250, 254, 251, 253, 226, 236, 250, 252, 249, 255, 254, 171, 189, 254, 250, 157, 168, 251, 252, 254, 253, 253, 252, 197, 253, 254, 214, 167, 249, 254
250, 250, 253, 251, 250, 229, 158, 187, 144, 130, 139, 105, 242, 251, 232, 172, 226, 203, 244, 253, 250, 253, 251, 252, 240, 250, 253, 252, 253, 253, 253, 180, 204, 253, 251, 155, 180, 252, 252, 252, 254, 253, 252, 205, 249, 254, 191, 148, 250, 254
253, 253, 254, 253, 250, 254, 176, 222, 178, 155, 134, 135, 241, 249, 174, 141, 200, 157, 246, 250, 252, 253, 244, 251, 235, 248, 253, 253, 252, 253, 252, 239, 251, 253, 253, 179, 229, 252, 251, 249, 253, 253, 251, 190, 237, 253, 172, 148, 248, 253
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120, 208, 219, 223, 169, 216, 221, 221, 220, 214, 150, 224, 145, 211, 237, 213, 229, 152, 199, 205, 239, 245, 234, 227, 219, 150, 127, 195, 229, 161, 117, 143, 154, 133, 183, 153, 217, 158, 139, 190, 172, 145, 141, 182, 101, 168, 175, 133, 96, 151
", " ", "");
t17 = String.Split(t16, {"
"});
t18 = String.Split(t17, {","});
t19 = String.ToNumber(t18);
t20 = String.Replace("148, 209, 164, 120, 194, 193, 191, 192, 190, 189, 190, 187, 190, 187, 190, 189, 191, 192, 189, 188, 188, 188, 186, 182, 178, 176, 160, 164, 172, 175, 178, 174, 181, 190, 190, 191, 192, 191, 192, 193, 196, 182, 121, 185, 207, 208, 200, 192, 190, 203
193, 208, 122, 102, 194, 190, 184, 190, 192, 189, 193, 191, 192, 190, 191, 189, 193, 191, 193, 193, 193, 199, 194, 191, 187, 187, 188, 180, 180, 187, 189, 181, 190, 193, 194, 195, 194, 195, 193, 195, 199, 179, 73, 191, 209, 207, 199, 191, 130, 203
201, 209, 107, 94, 191, 181, 132, 171, 194, 194, 195, 195, 192, 195, 196, 193, 190, 187, 194, 195, 198, 198, 199, 196, 187, 187, 191, 192, 186, 190, 192, 192, 197, 200, 193, 191, 198, 197, 191, 195, 202, 175, 111, 194, 208, 209, 192, 186, 126, 198
207, 210, 120, 99, 191, 123, 87, 102, 188, 191, 195, 198, 198, 194, 196, 194, 191, 179, 189, 195, 202, 202, 202, 199, 187, 185, 191, 191, 172, 191, 195, 196, 196, 198, 196, 195, 197, 198, 171, 191, 206, 187, 113, 199, 211, 212, 183, 171, 126, 198
211, 213, 137, 105, 188, 100, 76, 89, 177, 182, 186, 192, 184, 195, 196, 197, 192, 119, 181, 202, 205, 203, 203, 199, 163, 159, 197, 187, 124, 193, 197, 192, 194, 201, 202, 188, 191, 200, 152, 184, 206, 198, 160, 204, 210, 212, 149, 133, 160, 204
214, 213, 188, 131, 192, 88, 64, 74, 149, 122, 190, 113, 129, 199, 202, 197, 189, 97, 129, 203, 208, 204, 202, 199, 106, 107, 196, 183, 105, 192, 201, 184, 187, 203, 201, 171, 177, 201, 177, 188, 211, 205, 195, 200, 207, 210, 130, 116, 190, 207
214, 214, 204, 195, 200, 87, 64, 75, 103, 80, 179, 145, 159, 202, 203, 199, 185, 85, 101, 206, 207, 207, 204, 201, 103, 100, 199, 188, 107, 195, 201, 139, 160, 204, 199, 121, 140, 202, 194, 202, 211, 212, 203, 186, 206, 211, 135, 127, 197, 209
218, 215, 211, 207, 204, 92, 72, 85, 82, 68, 146, 91, 192, 204, 199, 195, 188, 81, 107, 209, 211, 210, 207, 201, 104, 115, 200, 196, 113, 203, 202, 113, 121, 206, 197, 109, 116, 204, 205, 210, 214, 213, 202, 155, 198, 211, 155, 132, 200, 217
212, 215, 216, 211, 210, 120, 85, 98, 85, 75, 96, 68, 195, 204, 193, 165, 189, 96, 168, 210, 209, 211, 208, 204, 163, 179, 206, 207, 184, 208, 203, 107, 123, 204, 192, 98, 107, 207, 205, 212, 214, 216, 206, 128, 193, 209, 148, 103, 187, 218
207, 211, 212, 216, 212, 168, 98, 126, 90, 77, 83, 68, 195, 205, 167, 105, 174, 145, 191, 211, 211, 209, 201, 201, 182, 198, 211, 208, 205, 205, 202, 118, 137, 211, 200, 97, 113, 207, 211, 211, 217, 216, 196, 140, 183, 209, 125, 92, 186, 210
212, 203, 206, 216, 213, 206, 112, 166, 122, 97, 77, 81, 193, 203, 110, 84, 138, 92, 192, 210, 213, 207, 182, 197, 172, 192, 211, 210, 211, 203, 198, 174, 187, 211, 207, 117, 160, 207, 207, 212, 219, 217, 190, 124, 169, 206, 108, 93, 181, 203
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74, 157, 172, 175, 116, 164, 174, 168, 169, 162, 102, 172, 93, 156, 187, 152, 174, 92, 143, 143, 188, 194, 179, 164, 155, 88, 78, 138, 183, 101, 74, 90, 100, 81, 130, 96, 162, 98, 82, 135, 117, 91, 89, 133, 55, 118, 125, 83, 54, 98
", " ", "");
t21 = String.Split(t20, {"
"});
t22 = String.Split(t21, {","});
t23 = String.ToNumber(t22);
t24 = String.Replace("37, 75, 50, 33, 72, 72, 78, 72, 69, 60, 62, 59, 63, 61, 62, 62, 66, 70, 67, 61, 63, 66, 61, 61, 60, 55, 45, 54, 63, 61, 57, 55, 56, 62, 67, 66, 66, 64, 69, 70, 71, 60, 32, 60, 75, 73, 78, 71, 71, 85
69, 74, 36, 35, 73, 72, 71, 80, 69, 67, 62, 61, 62, 60, 59, 63, 65, 66, 69, 62, 62, 68, 66, 68, 68, 66, 68, 61, 64, 67, 64, 58, 62, 67, 68, 69, 66, 66, 74, 71, 68, 52, 42, 64, 76, 72, 82, 78, 32, 87
76, 74, 38, 44, 71, 68, 40, 64, 75, 70, 67, 67, 64, 65, 64, 65, 64, 69, 70, 64, 62, 63, 66, 65, 67, 68, 71, 68, 62, 68, 64, 65, 69, 69, 64, 67, 70, 69, 66, 69, 71, 52, 44, 68, 71, 77, 69, 67, 51, 85
82, 76, 37, 42, 72, 33, 36, 40, 69, 72, 75, 74, 73, 65, 61, 63, 66, 61, 69, 65, 64, 64, 65, 65, 72, 69, 70, 69, 49, 68, 69, 74, 67, 70, 69, 71, 69, 72, 53, 67, 73, 64, 43, 75, 80, 81, 60, 58, 46, 87
80, 76, 37, 37, 73, 40, 45, 40, 70, 70, 62, 73, 66, 67, 62, 67, 71, 29, 61, 71, 67, 65, 66, 67, 48, 39, 73, 68, 32, 66, 72, 72, 72, 70, 73, 66, 65, 73, 40, 60, 72, 70, 44, 81, 80, 81, 47, 41, 54, 92
82, 73, 65, 32, 76, 38, 37, 39, 55, 34, 74, 37, 28, 71, 70, 69, 72, 36, 25, 72, 70, 66, 67, 71, 33, 28, 68, 57, 35, 71, 77, 60, 62, 71, 69, 48, 52, 73, 58, 64, 75, 81, 67, 83, 81, 83, 39, 42, 83, 94
76, 76, 77, 76, 80, 34, 39, 41, 41, 38, 77, 48, 46, 73, 77, 76, 68, 43, 35, 71, 66, 70, 70, 73, 33, 33, 73, 65, 19, 71, 76, 36, 45, 74, 73, 32, 34, 73, 70, 74, 75, 81, 86, 64, 86, 90, 44, 48, 90, 96
80, 79, 80, 81, 78, 34, 41, 42, 37, 39, 54, 28, 78, 75, 74, 77, 74, 38, 24, 74, 67, 72, 75, 77, 27, 21, 71, 75, 30, 78, 77, 34, 27, 75, 71, 38, 37, 77, 76, 79, 75, 81, 85, 47, 78, 90, 56, 54, 88, 98
79, 80, 78, 78, 83, 33, 42, 37, 41, 48, 37, 40, 84, 75, 75, 54, 84, 29, 59, 75, 68, 73, 77, 80, 53, 67, 72, 76, 59, 78, 77, 35, 32, 80, 67, 33, 37, 80, 78, 81, 77, 83, 87, 33, 70, 93, 59, 48, 74, 98
72, 80, 82, 74, 76, 60, 42, 48, 35, 40, 35, 44, 84, 80, 56, 32, 70, 59, 81, 74, 71, 76, 79, 80, 74, 81, 75, 73, 76, 79, 80, 28, 33, 72, 73, 31, 28, 82, 85, 80, 82, 83, 75, 45, 67, 92, 49, 50, 73, 95
78, 77, 77, 78, 77, 86, 26, 70, 50, 45, 42, 43, 82, 81, 30, 32, 39, 31, 83, 77, 75, 78, 59, 80, 61, 76, 75, 72, 73, 80, 76, 54, 63, 81, 78, 33, 50, 83, 82, 79, 86, 85, 65, 45, 61, 93, 36, 51, 70, 92
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18, 52, 56, 64, 14, 60, 68, 64, 64, 61, 28, 65, 24, 50, 69, 37, 61, 33, 52, 41, 73, 76, 68, 57, 46, 32, 36, 37, 73, 35, 42, 40, 35, 33, 52, 34, 69, 36, 30, 49, 43, 40, 38, 54, 25, 50, 48, 35, 31, 26
", " ", "");
t25 = String.Split(t24, {"
"});
t26 = String.Split(t25, {","});
t27 = String.ToNumber(t26);
color1 = Color.ByARGB(255, t19, t23, t27);
# ----------------------------------------
bySurfaceColors = Display.Display.BySurfaceColors(byLoft, code_block_6.color1)
patch = Curve.Patch(translate)
create = List.Create(bySurfaceColors, patch)
Banana = Output(create)
