# Dynamo custom node NURBS Curve and Diameter List to NURBS Surfaces.dyf (Dynamo 0.8.2.2371)
# category: Bakery.Geometry

curve_list = Input()
count = Count(curve_list)
code_block = CodeBlock(y=count) { 0..(y-1); }
diameter_list = Input()
subnode_for_nurbs_surface = Custom[subnode for Nurbs surface creation with diameter list](diameter_list=diameter_list, curve_list=curve_list)
map = List.Map(list=code_block, f_x=subnode_for_nurbs_surface.nurbs_surface)
nurbs_surfaces = Output(map)
count_2 = Count(curve_list)
code_block_2 = CodeBlock(y=count_2) { 0..(y-1); }
map_2 = List.Map(list=code_block_2, f_x=subnode_for_nurbs_surface.simple_loft)
simple_lofts = Output(map_2)
count_3 = Count(curve_list)
code_block_3 = CodeBlock(y=count_3) { 0..(y-1); }
map_3 = List.Map(list=code_block_3, f_x=subnode_for_nurbs_surface.simple_nurbs_surface)
simple_nurbs = Output(map_3)
