# Dynamo custom node Offset Point Z Value.dyf (Dynamo 0.9.2.4472)
# category: Bakery.Geometry

points = Input()
watch = Watch(points)
X = Point.X(watch)
Y = Point.Y(watch)
Z = Point.Z(watch)
desiredOffset = Input()
code_block = CodeBlock(z=Z, y=desiredOffset) { z+y; }
byCoordinates = Point.ByCoordinates(x=X, y=Y, z=code_block)
Point = Output(byCoordinates)
