# Dynamo custom node One Face to Polycurve Outline.dyf (Dynamo 0.8.2.2371)
# category: Bakery.Geometry

oneface = Input()
surfaceGeometry = Face.SurfaceGeometry(oneface)
edges = Face.Edges(surfaceGeometry)
curveGeometry = Edge.CurveGeometry(edges)
group_curves = Custom[Group Curves](Curves=curveGeometry)  # This node will take any input of flat list of curves and group them into sublists containing "joinable" curves that is continous curves. They might form closed curves or open curves. Use PolyCurve.ByJoinedCurves to convert output groups of curves into single PolyCurves
byJoinedCurves = PolyCurve.ByJoinedCurves(group_curves)
byGeometry = BoundingBox.ByGeometry()
map = List.Map(list=byJoinedCurves, f_x=byGeometry)
string_from_object = FromObject(map)
byGeometry_2 = BoundingBox.ByGeometry(surfaceGeometry)
string_from_object_2 = FromObject(byGeometry_2)
indexOf = IndexOf(string_from_object, string_from_object_2)
getItemAtIndex = List.GetItemAtIndex(list=byJoinedCurves, index=indexOf)
watch = Watch(getItemAtIndex)
outline = Output(watch)
