# Dynamo custom node Parse CSV Text of Elem IDs to Actual Revit Elements.dyf (Dynamo 0.9.2.4472)
# category: Bakery.Standalone
# input file path

FilePathNode = Input()
fromPath = FileObject(FilePathNode)  # "File.FromPath"
readText = File.ReadText(fromPath)
string = StringInput(",")
split = String.Split(readText, string)
watch = Watch(split)
bv_ids_to_elements = Custom[bv IDs to Elements](ID_s=watch)  # forked from CAAD_RWTH
elements = Output(bv_ids_to_elements.Element_s)
