# Dynamo custom node Parse Error Report and Provide Summary List.dyf (Dynamo 0.8.2.2392)
# category: Bakery.Standalone
# this version is intended to be faster

string = StringInput("ErrorSummary")
string_2 = StringInput("---Number of warnings---")
filePath = Input()
fromPath = FileObject(filePath)  # "File.FromPath"
readText = File.ReadText(fromPath)
string_3 = StringInput("<tr>  <td style=\"vertical-align:top;\">  ")
split = String.Split(readText, string_3)
number_slider = DoubleSlider(1, range=0..100 step 0.1)
dropItems = List.DropItems(list=split, amount=number_slider)
count = List.Count(dropItems)
string_4 = StringInput("---Number of Elements affected---")
string_5 = StringInput(" : id ")
split_2 = String.Split(readText, string_5)
number_slider_2 = DoubleSlider(1, range=0..100 step 0.1)
dropItems_2 = List.DropItems(list=split_2, amount=number_slider_2)
string_6 = StringInput(" ")
code_block = CodeBlock { true; }
bv_remove_from_string_after = Custom[bv Remove from String after Character](Character=string_6, ignoreCase=code_block)  # forked from Rhythm
map = List.Map(list=dropItems_2, f_x=bv_remove_from_string_after)
uniqueItems = List.UniqueItems(map)
sort = List.Sort(uniqueItems)
count_2 = List.Count(sort)
string_7 = StringInput("---List of warning types---")
string_8 = StringInput("  </td>")
code_block_2 = CodeBlock { true; }
bv_remove_from_string_after_2 = Custom[bv Remove from String after Character](Character=string_8, ignoreCase=code_block_2)
map_2 = List.Map(list=dropItems, f_x=bv_remove_from_string_after_2)
flatten = Flatten(map_2)
uniqueItems_2 = List.UniqueItems(flatten)
create = List.Create(string, string_2, count, string_4, count_2, string_7, uniqueItems_2)
flatten_2 = Flatten(create)
flatList = Output(flatten_2)
warningElementIDs = Output(uniqueItems)
