# Dynamo custom node Parse IFC File.dyf (Dynamo 0.8.0.950)
# category: Bakery.Standalone
# very basic implementation at this stage

filePath = Input()
fromPath = FileObject(filePath)  # "File.FromPath"
readText = File.ReadText(fromPath)
watch = Watch(readText)
code_block = CodeBlock { "******************************************************************************************/"; }
split = String.Split(watch, code_block)
restOfItems = List.RestOfItems(split)
string = StringInput("DATA;")
split_2 = String.Split(restOfItems, string)
restOfItems_2 = List.RestOfItems()
map = List.Map(list=split_2, f_x=restOfItems_2)
flatten = Flatten(map)
string_2 = StringInput("#")
split_3 = String.Split(flatten, string_2)
flatten_2 = Flatten(split_3)
flat_list_to_list_of_strings = Custom[Flat List to List of Strings](Original_List=flatten_2)  # using python methods
code_block_2 = CodeBlock { 1; }
length = String.Length()
sub = length - code_block_2
remove = String.Remove(str=code_block_2, startIndex=length, count=sub)
GetIFCinfoContaining = Input()
code_block_3 = CodeBlock { true; }
contains = String.Contains(str=remove, searchFor=GetIFCinfoContaining, ignoreCase=code_block_3)
filterByBoolMask = List.FilterByBoolMask(list=flat_list_to_list_of_strings, mask=contains)
search_results = Output(filterByBoolMask.in)
map_2 = List.Map(list=flat_list_to_list_of_strings, f_x=remove)
full_list = Output(map_2)
watch_2 = Watch(contains)
watch_3 = Watch(map_2)
watch_4 = Watch(flat_list_to_list_of_strings)
