# Dynamo custom node Parse Revit Error Report HTML and Output Summary.dyf (Dynamo 0.8.0.950)
# category: Bakery.Standalone
# this version gives more detail, slower

filePath = Input()
fromPath = FileObject(filePath)  # "File.FromPath"
readText = File.ReadText(fromPath)
string = StringInput("<tr>  <td style=\"vertical-align:top;\">  ")
split = String.Split(readText, string)
number_slider = DoubleSlider(1, range=0..100 step 0.1)
dropItems = List.DropItems(list=split, amount=number_slider)
number_slider_2 = DoubleSlider(1, range=0..100 step 0.1)
getItemAtIndex = List.GetItemAtIndex(list=dropItems, index=number_slider_2)
watch = Watch(dropItems)
string_2 = StringInput("""  </td>
<td>  """)
split_2 = String.Split(watch, string_2)
number_slider_3 = DoubleSlider(0, range=0..100 step 0.1)
dropItems_2 = List.DropItems(list=split_2, amount=number_slider_3)
watch_2 = Watch(dropItems_2)
string_3 = StringInput(" <br> ")
split_3 = String.Split(arg1=string_3)
map = List.Map(list=watch_2, f_x=split_3)
watch_3 = Watch(map)
string_4 = StringInput(" : id ")
split_4 = String.Split(arg1=string_4)
map_2 = List.Map(list=watch_3, f_x=split_4)
watch_4 = Watch(map_2)
number_slider_4 = DoubleSlider(1, range=0..100 step 0.1)
getItemAtIndex_2 = List.GetItemAtIndex(index=number_slider_4)
map_3 = List.Map(list=watch_4, f_x=getItemAtIndex_2)
number_slider_5 = DoubleSlider(1, range=0..100 step 0.1)
getItemAtIndex_3 = List.GetItemAtIndex(index=number_slider_5)
map_4 = List.Map(list=map_3, f_x=getItemAtIndex_3)
number_slider_6 = DoubleSlider(1, range=0..100 step 0.1)
getItemAtIndex_4 = List.GetItemAtIndex(index=number_slider_6)
map_5 = List.Map(list=map_4, f_x=getItemAtIndex_4)
watch_5 = Watch(map_5)
string_5 = StringInput(" </td>")
split_5 = String.Split(watch_5, string_5)
number_slider_7 = DoubleSlider(0, range=0..100 step 0.1)
getItemAtIndex_5 = List.GetItemAtIndex(index=number_slider_7)
map_6 = List.Map(list=split_5, f_x=getItemAtIndex_5)
number_slider_8 = DoubleSlider(1, range=0..100 step 0.1)
getItemAtIndex_6 = List.GetItemAtIndex(index=number_slider_8)
map_7 = List.Map(list=watch_4, f_x=getItemAtIndex_6)
number_slider_9 = DoubleSlider(0, range=0..100 step 0.1)
getItemAtIndex_7 = List.GetItemAtIndex(index=number_slider_9)
map_8 = List.Map(list=map_7, f_x=getItemAtIndex_7)
number_slider_10 = DoubleSlider(1, range=0..100 step 0.1)
getItemAtIndex_8 = List.GetItemAtIndex(index=number_slider_10)
map_9 = List.Map(list=map_8, f_x=getItemAtIndex_8)
watch_6 = Watch(map_9)
join = List.Join(map_6, watch_6)
uniqueItems = List.UniqueItems(join)
List_of_Elements_Affected = Output(uniqueItems)
watch_7 = Watch(uniqueItems)
count = List.Count(watch_7)
Count_of_Elements_Affected = Output(count)
number_slider_11 = DoubleSlider(0, range=0..100 step 0.1)
getItemAtIndex_9 = List.GetItemAtIndex(index=number_slider_11)
map_10 = List.Map(list=watch_4, f_x=getItemAtIndex_9)
number_slider_12 = DoubleSlider(0, range=0..100 step 0.1)
getItemAtIndex_10 = List.GetItemAtIndex(index=number_slider_12)
map_11 = List.Map(list=map_10, f_x=getItemAtIndex_10)
number_slider_13 = DoubleSlider(0, range=0..100 step 0.1)
getItemAtIndex_11 = List.GetItemAtIndex(index=number_slider_13)
map_12 = List.Map(list=map_11, f_x=getItemAtIndex_11)
count_2 = List.Count(map_12)
Count_of_Warnings = Output(count_2)
watch_8 = Watch(map_12)
uniqueItems_2 = List.UniqueItems(watch_8)
List_of_Warning_Types_Verbose = Output(uniqueItems_2)
