# Dynamo custom node Parse Revit Journal File.dyf (Dynamo 0.8.2.2392)
# category: Bakery.Standalone
# very basic implementation at this stage...

filePath = Input()
fromPath = FileObject(filePath)  # "File.FromPath"
readText = File.ReadText(fromPath)
watch = Watch(readText)
string = StringInput("' 0:< ")
split = String.Split(watch, string)
string_2 = StringInput("' 1:< ")
split_2 = String.Split(split, string_2)
string_3 = StringInput("' 2:< ")
split_3 = String.Split(split_2, string_3)
string_4 = StringInput("' 3:< ")
split_4 = String.Split(split_3, string_4)
string_5 = StringInput("' 4:< ")
split_5 = String.Split(split_4, string_5)
string_6 = StringInput("' 5:< ")
split_6 = String.Split(split_5, string_6)
string_7 = StringInput("' 6:< ")
split_7 = String.Split(split_6, string_7)
string_8 = StringInput("' 7:< ")
split_8 = String.Split(split_7, string_8)
string_9 = StringInput("' 8:< ")
split_9 = String.Split(split_8, string_9)
string_10 = StringInput("' 9:< ")
split_10 = String.Split(split_9, string_10)
string_11 = StringInput("' Build: ")
code_block = CodeBlock { " "; }
code_block_2 = CodeBlock { true; }
bv_remove_from_string_prior_to = Custom[bv Remove from String Prior to Character](str=string_11, Character=code_block, ignoreCase=code_block_2)  # forked from Rhythm
string_12 = StringInput("\n")
firstItem = List.FirstItem(split)
split_11 = String.Split(firstItem, string_11)
code_block_3 = CodeBlock { 1; }
getItemAtIndex = List.GetItemAtIndex(list=split_11, index=code_block_3)
splitByRegularExpression = Custom[String.SplitByRegularExpression](regex=string_12, string_s=getItemAtIndex)  # Splits a given string by a regular expression. The syntax for regular expressions is explained at http://ironpython-test.readthedocs.org/en/latest/howto/regex.html
firstItem_2 = List.FirstItem(splitByRegularExpression)
length = String.Length(firstItem_2)
code_block_4 = CodeBlock { 1; }
sub = length - code_block_4
remove = String.Remove(str=firstItem_2, startIndex=sub, count=code_block_4)
create = List.Create(bv_remove_from_string_prior_to, remove)
string_13 = StringInput("' Branch: ")
code_block_5 = CodeBlock { " "; }
code_block_6 = CodeBlock { true; }
bv_remove_from_string_prior_to_2 = Custom[bv Remove from String Prior to Character](str=string_13, Character=code_block_5, ignoreCase=code_block_6)
string_14 = StringInput("\n")
firstItem_3 = List.FirstItem(split)
split_12 = String.Split(firstItem_3, string_13)
code_block_7 = CodeBlock { 1; }
getItemAtIndex_2 = List.GetItemAtIndex(list=split_12, index=code_block_7)
splitByRegularExpression_2 = Custom[String.SplitByRegularExpression](regex=string_14, string_s=getItemAtIndex_2)
firstItem_4 = List.FirstItem(splitByRegularExpression_2)
length_2 = String.Length(firstItem_4)
code_block_8 = CodeBlock { 1; }
sub_2 = length_2 - code_block_8
remove_2 = String.Remove(str=firstItem_4, startIndex=sub_2, count=code_block_8)
create_2 = List.Create(bv_remove_from_string_prior_to_2, remove_2)
create_3 = List.Create(create, create_2)
Useful_List = Output(create_3)
length_3 = String.Length(split)
Number_of_journal_entries_at_top_level = Output(length_3)
