# Dynamo custom node Parse and Split String to a List.dyf (Dynamo 0.8.2.2371)
# category: Bakery.Standalone
# takes input String, split options, returns list or String

stringToParse = Input()
watch = Watch(stringToParse)
splitLeftExtentCharacter = Input()
split = String.Split(watch, splitLeftExtentCharacter)
splitRightExtentCharacter = Input()
split_2 = String.Split(split, splitRightExtentCharacter)
getIndex = Input(getIndex : int = 0)
getItemAtIndex = List.GetItemAtIndex(index=getIndex)
map = List.Map(list=split_2, f_x=getItemAtIndex)
itemsToRemoveFromList = Input(itemsToRemoveFromList : int = 1)
dropItems = List.DropItems(list=map, amount=itemsToRemoveFromList)
AsList = Output(dropItems)
string_from_array = FromArray(dropItems)
code_block = CodeBlock { 0; }
code_block_2 = CodeBlock { 1; }
remove = String.Remove(str=string_from_array, startIndex=code_block, count=code_block_2)
length = String.Length(remove)
code_block_3 = CodeBlock(x=length) { x-1; }
code_block_4 = CodeBlock { 1; }
remove_2 = String.Remove(str=remove, startIndex=code_block_3, count=code_block_4)
AsSingleString = Output(remove_2)
