# Dynamo custom node Place Family by Point Cloud.dyf (Dynamo 0.7.5.3566)
# category: Bakery.PointCloud
# allows dropitems from 0 to 4 (discards half of the points at each drop level). Needs XYZ space or comma delimited text file. The Topography creation option does not seem to work well with huge numbers of points...
# Refer to What Revit Wants post for more details.

string = StringInput("PointCloud")
string_2 = StringInput("Point")
byFamilyNameAndTypeName = FamilySymbol.ByFamilyNameAndTypeName(string, string_2)
File_Path_to_Text_File = Input()
fromPath = FileObject(File_Path_to_Text_File)  # "File.FromPath"
readFromFile = CSV.ReadFromFile(fromPath)
flatten = Flatten(readFromFile)
integer_slider = IntegerSlider(2, range=0..100)
integer_slider_2 = IntegerSlider(0, range=0..100)
dropEveryNthItem = List.DropEveryNthItem(flatten, integer_slider, integer_slider_2)
integer_slider_3 = IntegerSlider(2, range=0..100)
integer_slider_4 = IntegerSlider(0, range=0..100)
dropEveryNthItem_2 = List.DropEveryNthItem(dropEveryNthItem, integer_slider_3, integer_slider_4)
integer_slider_5 = IntegerSlider(2, range=0..100)
integer_slider_6 = IntegerSlider(0, range=0..100)
dropEveryNthItem_3 = List.DropEveryNthItem(dropEveryNthItem_2, integer_slider_5, integer_slider_6)
integer_slider_7 = IntegerSlider(2, range=0..100)
integer_slider_8 = IntegerSlider(0, range=0..100)
dropEveryNthItem_4 = List.DropEveryNthItem(dropEveryNthItem_3, integer_slider_7, integer_slider_8)
create = List.Create(flatten, dropEveryNthItem, dropEveryNthItem_2, dropEveryNthItem_3, dropEveryNthItem_4)
Number_of_drops_int_0_to_4 = Input()  # "Number of drops (int, 0 to 4)"
getItemAtIndex = List.GetItemAtIndex(create, Number_of_drops_int_0_to_4)
flat_list_to_list_of_strings = Custom[Flat List to List of Strings](Original_List=getItemAtIndex)  # using python methods
count = Count(flat_list_to_list_of_strings)
integer_slider_9 = IntegerSlider(1, range=0..100)
sub = count - integer_slider_9
chop = List.Chop(flat_list_to_list_of_strings, sub)
integer_slider_10 = IntegerSlider(0, range=0..100)
getItemAtIndex_2 = List.GetItemAtIndex(chop, integer_slider_10)
Delimiter_str = Input()  # "Delimiter (str)"
split = String.Split(getItemAtIndex_2, Delimiter_str)
toNumber = String.ToNumber(split)
transpose = List.Transpose(toNumber)
integer_slider_11 = IntegerSlider(0, range=0..100)
getItemAtIndex_3 = List.GetItemAtIndex(transpose, integer_slider_11)
number = DoubleInput(1)
mul = getItemAtIndex_3 * number
integer_slider_12 = IntegerSlider(1, range=0..100)
getItemAtIndex_4 = List.GetItemAtIndex(transpose, integer_slider_12)
mul_2 = getItemAtIndex_4 * number
integer_slider_13 = IntegerSlider(2, range=0..100)
getItemAtIndex_5 = List.GetItemAtIndex(transpose, integer_slider_13)
mul_3 = getItemAtIndex_5 * number
byCoordinates = Point.ByCoordinates(mul, mul_2, mul_3)
string_3 = StringInput("no fams")
create_2 = List.Create(byCoordinates, string_3)
Should_we_go_and_place_instances_bool = Input()  # "Should we go and place instances? (bool)"
boolean = BoolSelector(true)
eq = Should_we_go_and_place_instances_bool == boolean
integer_slider_14 = IntegerSlider(0, range=0..100)
integer_slider_15 = IntegerSlider(1, range=0..100)
if_ = If(eq, integer_slider_14, integer_slider_15)
getItemAtIndex_6 = List.GetItemAtIndex(create_2, if_)
byPoint = FamilyInstance.ByPoint(byFamilyNameAndTypeName, getItemAtIndex_6)
InstancePlacer = Output(byPoint)
Number_of_points_at_current_drop_level = Output(count)
Required_family_name = Output(string)
Required_type_name = Output(string_2)
string_4 = StringInput("no topo")
create_3 = List.Create(byCoordinates, string_4)
Do_you_want_to_make_a_Topo_bool = Input()  # "Do you want to make a Topo? (bool)"
boolean_2 = BoolSelector(true)
eq_2 = Do_you_want_to_make_a_Topo_bool == boolean_2
integer_slider_16 = IntegerSlider(0, range=0..100)
integer_slider_17 = IntegerSlider(2, range=0..100)
if_2 = If(eq_2, integer_slider_16, integer_slider_17)
watch = Watch(if_2)
getItemAtIndex_7 = List.GetItemAtIndex(create_3, watch)
create_4 = List.Create(getItemAtIndex_7)
byPoints = Topography.ByPoints(create_4)
topo = Output(byPoints)
PointList = Output(byCoordinates)
