# Dynamo custom node Point and Tangent Lists to Nurbs and Polycurves.dyf (Dynamo 0.8.2.2371)
# category: Bakery.Geometry

point_sublists = Input()
watch = Watch(point_sublists)
count = Count(watch)
code_block = CodeBlock(X=count) { 0..(X-1); }
start_vector_list = Input()
watch_2 = Watch(start_vector_list)
end_vector_list = Input()
watch_3 = Watch(end_vector_list)
subnode_to_make_forms_from_flex = Custom[subnode to Make Forms from Flex Duct via NURBS](points=watch, startTans=watch_2, endTans=watch_3)
map = List.Map(list=code_block, f_x=subnode_to_make_forms_from_flex.nurbs_using_tangents)
nurbs_curves_using_tangents = Output(map)
map_2 = List.Map(list=code_block, f_x=subnode_to_make_forms_from_flex.polycurves_by_points)
polycurves = Output(map_2)
map_3 = List.Map(list=code_block, f_x=subnode_to_make_forms_from_flex.bspline_nurbs_using_tangents)
bspline_nurbs = Output(map_3)
