# Dynamo custom node Polycurve to Nearest Revit Level by Elevation.dyf (Dynamo 0.8.2.2371)
# category: Bakery.Geometry

polycurves = Input()
startPoint = Curve.StartPoint(polycurves)
find_revit_level_for_points_by = Custom[Find Revit Level for Points by Elevation](point=startPoint)
flatten = Flatten(find_revit_level_for_points_by)
var = Output(flatten)  # "var[]"
