# Dynamo custom node Read CSV to Flat List.dyf (Dynamo 0.8.2.2371)
# category: Bakery.Standalone

path = Input()
fromPath = FileObject(path)  # "File.FromPath"
readFromFile = CSV.ReadFromFile(fromPath)
flatten = Flatten(readFromFile)
var = Output(flatten)  # "var[]"
