# Dynamo custom node Remove Chars from End of Single String.dyf (Dynamo 0.8.0.950)
# category: Bakery.Functions
# use list.map for multiple

oneString = Input()
length = String.Length(oneString)
charsToRemove = Input()
sub = length - charsToRemove
remove = String.Remove(str=oneString, startIndex=sub, count=charsToRemove)
shorterString = Output(remove)
