# Dynamo custom node Revit Unit Values to Length Display Unit.dyf (Dynamo 1.0.0.1180)
# category: Bakery.Units

val = Input(val : double)
unit_types = UnitTypes("Length")
displayUnitType = Custom[UnitType.DisplayUnitType](unitType=unit_types)  # Retrieves the display unit type for a given unit type.
toDisplayUnit = Custom[InternalUnit.ToDisplayUnit](val=val, displayUnitType=displayUnitType.displayUnitType)  # Converts a value from Revit's internal unit to a given display unit
displayValues = Output(toDisplayUnit)
