# Dynamo custom node Revit Vector Parameter to Dynamo Vector Element.dyf (Dynamo 0.8.2.2371)
# category: Bakery.Geometry

one_param = Input()
comma_separated_revit_data_to = Custom[Comma Separated Revit Data to XYZ Values](item=one_param)
byCoordinates = Vector.ByCoordinates(x=comma_separated_revit_data_to.X, y=comma_separated_revit_data_to.Y, z=comma_separated_revit_data_to.Z)
one_vector = Output(byCoordinates)
