# Dynamo custom node Revit Vectors to Dynamo Vectors.dyf (Dynamo 0.8.2.2371)
# category: Bakery.Geometry

revitVectors = Input()
turnIntoList = Custom[TurnIntoList](revitVectors)  # Turns an element (or a nested list) into a flat list
revit_vector_parameter_to_dynamo = Custom[Revit Vector Parameter to Dynamo Vector Element]()
map = List.Map(list=turnIntoList, f_x=revit_vector_parameter_to_dynamo)
dynamoVectors = Output(map)
