# Dynamo custom node Room to Element Geometry Test for Preflight.dyf (Dynamo 0.9.2.4472)
# category: Bakery.Geometry

roomsIn = Input()
watch = Watch(roomsIn)
code_block = CodeBlock { true; }
code_block_2 = CodeBlock { "Area"; }
getParameterValueByName = Element.GetParameterValueByName(element=watch, parameterName=code_block_2)
watch_2 = Watch(getParameterValueByName)
removeRoomsWithAreaLessThanM2 = Input()
lt = watch_2 < removeRoomsWithAreaLessThanM2
bv_replace_nulls = Custom[bv Replace Nulls](replacement=code_block, seq=lt)
filterByBoolMask = List.FilterByBoolMask(list=watch, mask=bv_replace_nulls)
removedTooSmall = Output(filterByBoolMask.in)
watch_3 = Watch(filterByBoolMask.out)
geometry = Element.Geometry(watch_3)
firstItem = List.FirstItem()
map = List.Map(list=geometry, f_x=firstItem)
bv_replace_nulls_2 = Custom[bv Replace Nulls](replacement=code_block, seq=map)
bv_all_indices_of = Custom[bv All Indices Of](list=bv_replace_nulls_2, indices=code_block)  # forked from Rhythm
removeItemAtIndex = List.RemoveItemAtIndex(list=watch_3, indices=bv_all_indices_of)
roomListGoodToGo = Output(removeItemAtIndex)
getItemAtIndex = List.GetItemAtIndex(list=watch_3, index=bv_all_indices_of)
geometryFailed = Output(getItemAtIndex)
