# Dynamo custom node Search for Certain Build Number in Folder of RVTs.dyf (Dynamo 0.8.1.1942)
# category: Bakery.Standalone

directoryPath = Input()
file_list_from_file_path = Custom[File List from File Path](DirectoryPath=directoryPath)
code_block = CodeBlock { "\"; }
split = String.Split(file_list_from_file_path, code_block)
lastItem = List.LastItem()
map = List.Map(list=split, f_x=lastItem)
get_build_number_from_all_rvts = Custom[Get Build Number from All RVTs in a Folder](directoryPath=directoryPath)
code_block_2 = CodeBlock { 1; }
getItemAtIndex = List.GetItemAtIndex(index=code_block_2)
map_2 = List.Map(list=get_build_number_from_all_rvts, f_x=getItemAtIndex)
searchForVersion = Input()
contains = String.Contains(str=map_2, searchFor=searchForVersion)
filterByBoolMask = List.FilterByBoolMask(list=map, mask=contains)
matchingSearch = Output(filterByBoolMask.in)
others = Output(filterByBoolMask.out)
