# Dynamo custom node Select Elements Using BuiltIn Category Names.dyf (Dynamo 0.9.2.4472)
# category: Bakery.Collect
# works on a list of BuiltIn Names

builtIns = Input()
select_based_on_a_single_builtin = Custom[Select based on a single builtin name]()  # asdf
map = List.Map(list=builtIns, f_x=select_based_on_a_single_builtin)
bv_remove_nulls = Custom[bv Remove Nulls](List=map)  # forked from Lunchbox
flatten = Flatten(bv_remove_nulls)
elements = Output(flatten)
