# Dynamo custom node Set List of Values to List of Elements for One Parameter.dyf (Dynamo 0.8.2.2371)
# category: Bakery.Parameters
# as described

elementList = Input()
parameterNameAsString = Input()
create = List.Create(parameterNameAsString)
count = List.Count(elementList)
cycle = List.Cycle(list=create, amount=count)
valuesToSet = Input()
setParameterByName = Element.SetParameterByName(element=elementList, parameterName=cycle, value=valuesToSet)
watch = Watch(setParameterByName)
elementsOut = Output(watch)
