# Dynamo custom node Set OriginalNestingLevel Parameter to Element.dyf (Dynamo 0.8.0.950)
# category: Bakery.Nesting
# works with other node -- Set OriginalNesting Level Parameter for all FamilyInstances

elementToSet = Input()
string = StringInput("OriginalNestingLevel")
valueToSetInteger = Input()
setParameterByName = Element.SetParameterByName(element=elementToSet, parameterName=string, value=valueToSetInteger)
