# Dynamo custom node Solid Loft using First and Last Cross section.dyf (Dynamo 0.8.2.2392)
# category: Bakery.Geometry

cross_section_list = Input()
watch = Watch(cross_section_list)
firstItem = List.FirstItem(watch)
lastItem = List.LastItem(watch)
create = List.Create(firstItem, lastItem)
byLoft = Solid.ByLoft(create)
Solid = Output(byLoft)
