# Dynamo custom node Speak Single String via Speech Synthesizer.dyf (Dynamo 0.9.2.4472)
# category: Bakery.Standalone

str = Input(str : string)
string = StringInput(" ")
split = String.Split(str, string)
python_script = Python(IN[0]=split)
# ---------- python_script.python (11 lines) ----------
import clr
clr.AddReference('System.Speech')
from System.Speech.Synthesis import SpeechSynthesizer

str = IN[0]

for i in str:
	spk = SpeechSynthesizer()
	spk.Speak(i)
#Assign your output to the OUT variable.
OUT = "done"
# ----------------------------------------
sent_to_speakers = Output(python_script)
