# Dynamo custom node Sublists of Coordinates to Points.dyf (Dynamo 0.8.2.2392)
# category: Bakery.Geometry

big_list = Input()
subnode_to_create_point_from_one = Custom[Subnode to create point from one XYZ sublist]()
map = List.Map(list=big_list, f_x=subnode_to_create_point_from_one)
Points = Output(map)
