# Dynamo custom node To Int.dyf (Dynamo 1.0.0.1180)
# category: Bakery.Math

listIn = Input()
python_script = Python(IN[0]=listIn)
# ---------- python_script.python (11 lines) ----------
import clr
clr.AddReference('ProtoGeometry')
from Autodesk.DesignScript.Geometry import *
#The inputs to this node will be stored as a list in the IN variables.
dataEnteringNode = IN[0]
intlist = []
for x in dataEnteringNode:
	intlist.append(int(x))

#Assign your output to the OUT variable.
OUT = intlist
# ----------------------------------------
ints = Output(python_script)
