# Dynamo custom node UUID GUID Generator for Lists.dyf (Dynamo 0.8.2.2371)
# category: Bakery.Standalone
# just makes a new GUID for every item in a list, has no relationship to item or element itself

list = Input()
python_script = Python(IN[0]=list)
# ---------- python_script.python (14 lines) ----------
import clr
clr.AddReference('ProtoGeometry')
from Autodesk.DesignScript.Geometry import *
from System import Guid
inputlist = IN[0]
uuidlist = list()
uuidstrs = list()
for i in inputlist:
	temp = Guid.NewGuid()
	asString = temp.ToString()
	uuidlist.append(temp)
	uuidstrs.append(asString)

OUT = uuidlist, uuidstrs
# ----------------------------------------
code_block = CodeBlock(x=python_script) { x[0]; x[1]; }
uuids = Output(code_block.out0)
uuidsAsStrings = Output(code_block.out1)
