# Dynamo custom node Write to Excel using only Data and File Path Inputs.dyf (Dynamo 0.8.2.2371)
# category: Bakery.Excel
# will overwrite and use Sheet1

filePath = Input(filePath : string)
code_block = CodeBlock { "Sheet1"; }
code_block_2 = CodeBlock { 0; }
data = Input(data : var[][])
code_block_3 = CodeBlock { true; }
writeToFile = Excel.WriteToFile(filePath=filePath, sheetName=code_block, startRow=code_block_2, startCol=code_block_2, data=data, overWrite=code_block_3)
data_2 = Output(writeToFile)  # "data"
