# Dynamo custom node ZYX sublist strings to XYZ sublist numbers.dyf (Dynamo 0.8.2.2392)
# category: Bakery.Geometry

list_with_ZYX_sublist_strings = Input()
watch = Watch(list_with_ZYX_sublist_strings)
code_block = CodeBlock { 2; }
getItemAtIndex = List.GetItemAtIndex(index=code_block)
map = List.Map(list=watch, f_x=getItemAtIndex)
watch_2 = Watch(map)
toNumber = String.ToNumber(watch_2)
divide_by_this_for_units = Input()
code_block_2 = CodeBlock(x=toNumber, y=divide_by_this_for_units) { x/y; }
code_block_3 = CodeBlock { 1; }
getItemAtIndex_2 = List.GetItemAtIndex(index=code_block_3)
map_2 = List.Map(list=watch, f_x=getItemAtIndex_2)
watch_3 = Watch(map_2)
toNumber_2 = String.ToNumber(watch_3)
code_block_4 = CodeBlock(x=toNumber_2, y=divide_by_this_for_units) { x/y; }
code_block_5 = CodeBlock { 0; }
getItemAtIndex_3 = List.GetItemAtIndex(index=code_block_5)
map_3 = List.Map(list=watch, f_x=getItemAtIndex_3)
watch_4 = Watch(map_3)
toNumber_3 = String.ToNumber(watch_4)
code_block_6 = CodeBlock(x=toNumber_3, y=divide_by_this_for_units) { x/y; }
create = List.Create(code_block_2, code_block_4, code_block_6)
transpose = List.Transpose(create)
lists = Output(transpose)
