# Dynamo custom node bv IDs to Elements.dyf (Dynamo 0.9.2.4472)
# category: Bakery.Forks
# forked from CAAD_RWTH

ID_s = Input()  # "ID(s)"
id_to_element = Custom[Id to Element](Id=ID_s)  # Selects elements in a model from id input (ElementId, string, integer or GUID)
Element_s = Output(id_to_element)  # "Element(s)"
