# Dynamo custom node bv Merge Sublists with a separator.dyf (Dynamo 0.8.2.2392)
# category: Bakery.Forks
# forked from Rhythm

List = Input()
Character = Input()
python_script = Python(IN[0]=List, IN[1]=Character)
# ---------- python_script.python (3 lines) ----------
initial = IN[0]
result = map(IN[1].join, initial)
OUT=result
# ----------------------------------------
OUT = Output(python_script)
