# Dynamo custom node one Revit Element to a Best Fit Line.dyf (Dynamo 1.0.0.1180)
# category: Bakery.Geometry

element = Input(element : Element)
geometry = Element.Geometry(element)
firstItem = List.FirstItem(geometry)
vertices = Topology.Vertices(firstItem)
pointGeometry = Vertex.PointGeometry(vertices)
byBestFitThroughPoints = Line.ByBestFitThroughPoints(pointGeometry)
Line = Output(byBestFitThroughPoints)
