# Dynamo custom node one Room to its PolyCurves.dyf (Dynamo 0.8.2.2371)
# category: Bakery.Geometry
# for list.map, nested

oneRoom = Input()
boundaries = Custom[Room.Boundaries](Room_s=oneRoom)  # Gets a list of all boundary elements of a given room or area
group_curves = Custom[Group Curves](Curves=boundaries.Curves)  # This node will take any input of flat list of curves and group them into sublists containing "joinable" curves that is continous curves. They might form closed curves or open curves. Use PolyCurve.ByJoinedCurves to convert output groups of curves into single PolyCurves
byJoinedCurves = PolyCurve.ByJoinedCurves(group_curves)
PolyCurve = Output(byJoinedCurves)
