# Dynamo custom node subnode to Copy One File to New Directory.dyf (Dynamo 0.9.1.4062)
# category: Bakery.Standalone

string = StringInput("\")
directoryWithoutEndSlash = Input()
filepathlist = Input()
counter = Input()
getItemAtIndex = List.GetItemAtIndex(list=filepathlist, index=counter)
boolean = BoolSelector(true)
fileName = FilePath.FileName(getItemAtIndex, boolean)
join = String.Join(string, directoryWithoutEndSlash, fileName)
fromPath = FileObject(join)  # "File.FromPath"
fromPath_2 = FileObject(filepathlist)  # "File.FromPath"
getItemAtIndex_2 = List.GetItemAtIndex(list=fromPath_2, index=counter)
boolean_2 = BoolSelector(true)
copy = File.Copy(getItemAtIndex_2, join, boolean_2)
void = Output(copy)
