# Dynamo graph AccessGeometry.dyn (Dynamo 1.3.2.2480)

select_model_elements = DSModelElementsSelection()  # 1 picked in the model
getLocation = Element.GetLocation(select_model_elements)
code_block = CodeBlock(a=select_model_elements) { {a}; }
python_script = Python(IN[0]=code_block)
# ---------- python_script.python (38 lines) ----------
import clr

clr.AddReference("RevitServices")
import RevitServices
from RevitServices.Persistence import DocumentManager
from RevitServices.Transactions import TransactionManager
doc = DocumentManager.Instance.CurrentDBDocument

clr.AddReference("RevitAPI")
import Autodesk
from Autodesk.Revit.DB import *

clr.AddReference("RevitNodes")
import Revit
clr.ImportExtensions(Revit.Elements)
clr.ImportExtensions(Revit.GeometryConversion)

opt = Options()
opt.ComputeReferences = True
opt.IncludeNonVisibleObjects = True
opt.DetailLevel = ViewDetailLevel.Coarse;
   

pipe = UnwrapElement(IN[0])

geo = []
for obj in pipe[0].get_Geometry(opt):
	try:
		geometry = obj.GetInstanceGeometry()
		for g in geometry:
			if g.ToProtoType() != None:
				geo.append(g)
	except:
		""
lineLength = [g.Length for g in geo]


OUT = geo[lineLength.index(max(lineLength))].ToProtoType()
# ----------------------------------------
byCurve = ModelCurve.ByCurve(python_script)
