# Dynamo graph Adaptive components.dyn (Dynamo 2.2.0.4667)

integer_slider = IntegerSlider(0, range=-1..1 step 1)
byCoordinates = UV.ByCoordinates(u=integer_slider, v=integer_slider)
watch = Watch(byCoordinates)
integer_slider_2 = IntegerSlider(1, range=0..1 step 1)
byCoordinates_2 = UV.ByCoordinates(u=integer_slider_2, v=integer_slider)
watch_2 = Watch(byCoordinates_2)
byCoordinates_3 = UV.ByCoordinates(u=integer_slider_2, v=integer_slider_2)
watch_3 = Watch(byCoordinates_3)
byCoordinates_4 = UV.ByCoordinates(u=integer_slider, v=integer_slider_2)
watch_4 = Watch(byCoordinates_4)
list_create = List.Create(item0=watch, item1=watch_2, item2=watch_3, item3=watch_4)
number_slider = DoubleSlider(0, range=0..5000 step 1)
byCoordinates_5 = Point.ByCoordinates(x=number_slider, y=number_slider, z=number_slider)
number_slider_2 = DoubleSlider(2923, range=0..5000 step 1)
byCoordinates_6 = Point.ByCoordinates(x=number_slider_2, y=number_slider, z=number_slider)
byStartPointEndPoint = Line.ByStartPointEndPoint(startPoint=byCoordinates_5, endPoint=byCoordinates_6)
number_slider_3 = DoubleSlider(2571, range=0..5000 step 1)
byCoordinates_7 = Vector.ByCoordinates(z=number_slider_3)
extrude = Curve.Extrude(curve=byStartPointEndPoint, direction=byCoordinates_7)
byGeometry = ImportInstance.ByGeometry(geometry=extrude)
elementFaceReferences = Element.ElementFaceReferences(element=byGeometry)
family_types = FamilyTypes("Family1:Family1")
byParametersOnFace = AdaptiveComponent.ByParametersOnFace(uvs=list_create, surface=elementFaceReferences, familyType=family_types)
startPoint = Curve.StartPoint(curve=byStartPointEndPoint)
translate = Geometry.Translate(geometry=byStartPointEndPoint, direction=byCoordinates_7)
startPoint_2 = Curve.StartPoint(curve=translate)
endPoint = Curve.EndPoint(curve=translate)
endPoint_2 = Curve.EndPoint(curve=byStartPointEndPoint)
list_create_2 = List.Create(item0=startPoint, item1=startPoint_2, item2=endPoint, item3=endPoint_2)
code_block = CodeBlock(a=list_create_2) { [a]; }
byPoints = AdaptiveComponent.ByPoints(points=code_block, familyType=family_types)
python_script = Python(IN[0]=list_create_2, IN[1]=family_types)
# ---------- python_script.python (37 lines) ----------
import clr
clr.AddReference("RevitAPI")
clr.AddReference("ProtoGeometry")
clr.AddReference("RevitNodes")
clr.AddReference("RevitServices")
clr.AddReference('RevitAPIUI')
clr.AddReference('DSCoreNodes') 
import DSCore
from DSCore import *
import Autodesk
import Revit
clr.ImportExtensions(Revit.GeometryConversion)
import RevitServices
from Autodesk.Revit.DB import *
from Autodesk.DesignScript.Geometry import *
from RevitServices.Persistence import DocumentManager
from RevitServices.Transactions import TransactionManager
from System import Array

doc = DocumentManager.Instance.CurrentDBDocument
plist = IN[0]
typelist= UnwrapElement(IN[1])
count=0

TransactionManager.Instance.EnsureInTransaction(doc)
count = 0

adaptComp = AdaptiveComponentInstanceUtils.CreateAdaptiveComponentInstance(doc, doc.GetElement(typelist.Id))
adaptPoint = AdaptiveComponentInstanceUtils.GetInstancePlacementPointElementRefIds(adaptComp)
	
for p,z in zip(plist,adaptPoint):
	point = p.ToXyz()
	aPt1 = doc.GetElement(z)
	trans1 = point.Subtract(aPt1.Position)
	new_el = ElementTransformUtils.MoveElement(doc, aPt1.Id, trans1)
TransactionManager.Instance.TransactionTaskDone()		
OUT = adaptComp
# ----------------------------------------
