# Dynamo graph From Flux.dyn (Dynamo 1.2.3.592)

byCoordinates = Point.ByCoordinates()
file_path = Filename("C:\Users\giovanni.brogioli\Documents\Dynamo\Scripts\Adaptive\coordinates2.csv")
code_block = CodeBlock { "Sheet3"; }
code_block_2 = CodeBlock { 0; }
flux_project = ProjectsNodeModel()
flow_control = FlowControlNodeModel()
receive_from_flux = FromFluxNodeModel(flux_project, flow_control)
code_block_3 = CodeBlock { "{"; }
code_block_4 = CodeBlock { ""; }
replace = String.Replace(str=receive_from_flux, searchFor=code_block_3, replaceWith=code_block_4)
code_block_5 = CodeBlock { "}"; }
code_block_6 = CodeBlock { ""; }
replace_2 = String.Replace(str=replace, searchFor=code_block_5, replaceWith=code_block_6)
code_block_7 = CodeBlock { 1; }
flatten = List.Flatten(list=replace_2, amt=code_block_7)
code_block_8 = CodeBlock { 1; }
writeToFile = Excel.WriteToFile(filePath=file_path, sheetName=code_block, startRow=code_block_2, startCol=code_block_2, data=flatten, overWrite=code_block_8)
