# Grasshopper definition GH to Flux.gh (Grasshopper 0.9.75)
# plug-ins: Flux.Grasshopper

srf = Surface([<surface referenced from the Rhino model> x32])
debrep = DeconstructBrep(Brep=srf)  # -> Faces, Edges, Vertices
panel = Panel(debrep.Vertices)
flux = FluxProject(project="a6ZAgj3PY5Pqk56N4")  # -> Keys, Meta
select_from_list = SelectFromList(flux.Keys, SelectedItem="402324b59a3c62bcfa64568ae2548fbb")
item = ListItem(List=panel, Index=Slider(0, range=0..100), Wrap=True)
select_from_list_2 = SelectFromList(flux.Keys, SelectedItem="409d3cba4bc6e12ee4b739a0eb1cfe78")
item_2 = ListItem(List=panel, Index=Slider(1, range=0..100), Wrap=True)
select_from_list_3 = SelectFromList(flux.Keys, SelectedItem="40ce1646f0702efe62d8be5431aaa9a1")
item_3 = ListItem(List=panel, Index=Slider(2, range=0..2), Wrap=True)
panel_2 = Panel(item)
flow_control = FlowControl({"Once", "Constantly"}, selected="Once")
flow_control_2 = FlowControl({"Once", "Constantly"}, selected="Once")
to_flux = ToFlux(
    Keys=select_from_list,
    Value=item,
    Mode=flow_control,
    isNotificationEnabled=True,
    keyId="402324b59a3c62bcfa64568ae2548fbb",
    projectId="a6ZAgj3PY5Pqk56N4",
    Branch0_Path="{0;0}",
    Branch0_Item0_null_string=False,
    Branch0_Item0_string="{-153552.963554, -40525.201328, 589802.212249}",
    Branch0_Item0_TypeName="Grasshopper.Kernel.Types.GH_String",
    Branch1_Path="{0;1}",
    Branch1_Item0_null_string=False,
    Branch1_Item0_string="{-153551.503743, -37480.070125, 590437.589723}",
    Branch1_Item0_TypeName="Grasshopper.Kernel.Types.GH_String",
    Branch2_Path="{0;2}",
    Branch2_Item0_null_string=False,
    Branch2_Item0_string="{-155401.937474, -38241.516605, 589942.768659}",
    Branch2_Item0_TypeName="Grasshopper.Kernel.Types.GH_String",
    Branch3_Path="{0;3}",
    Branch3_Item0_null_string=False,
    Branch3_Item0_string="{-155401.937474, -38241.516605, 589942.768659}",
    Branch3_Item0_TypeName="Grasshopper.Kernel.Types.GH_String",
    Branch4_Path="{0;4}",
    Branch4_Item0_null_string=False,
    Branch4_Item0_string="{-153552.233649, -39002.635727, 590119.900986}",
    Branch4_Item0_TypeName="Grasshopper.Kernel.Types.GH_String",
    Branch5_Path="{0;5}",
    Branch5_Item0_null_string=False,
    Branch5_Item0_string="{-157252.371205, -39002.963084, 589447.947596}",
    Branch5_Item0_TypeName="Grasshopper.Kernel.Types.GH_String",
    Branch6_Path="{0;6}",
    Branch6_Item0_null_string=False,
    Branch6_Item0_string="{-157252.371205, -39002.963084, 589447.947596}"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)
flow_control_3 = FlowControl({"Once", "Constantly"}, selected="Once")
to_flux_2 = ToFlux(
    Keys=select_from_list_2,
    Value=item_2,
    Mode=flow_control_2,
    isNotificationEnabled=True,
    keyId="409d3cba4bc6e12ee4b739a0eb1cfe78",
    projectId="a6ZAgj3PY5Pqk56N4",
    Branch0_Path="{0;0}",
    Branch0_Item0_null_string=False,
    Branch0_Item0_string="{-153553.69346, -42047.76693, 589484.523512}",
    Branch0_Item0_TypeName="Grasshopper.Kernel.Types.GH_String",
    Branch1_Path="{0;1}",
    Branch1_Item0_null_string=False,
    Branch1_Item0_string="{-155401.207569, -36718.951003, 590260.457397}",
    Branch1_Item0_TypeName="Grasshopper.Kernel.Types.GH_String",
    Branch2_Path="{0;2}",
    Branch2_Item0_null_string=False,
    Branch2_Item0_string="{-157251.641299, -37480.397483, 589765.636333}",
    Branch2_Item0_TypeName="Grasshopper.Kernel.Types.GH_String",
    Branch3_Path="{0;3}",
    Branch3_Item0_null_string=False,
    Branch3_Item0_string="{-153551.503743, -37480.070125, 590437.589723}",
    Branch3_Item0_TypeName="Grasshopper.Kernel.Types.GH_String",
    Branch4_Path="{0;4}",
    Branch4_Item0_null_string=False,
    Branch4_Item0_string="{-155401.937474, -38241.516605, 589942.768659}",
    Branch4_Item0_TypeName="Grasshopper.Kernel.Types.GH_String",
    Branch5_Path="{0;5}",
    Branch5_Item0_null_string=False,
    Branch5_Item0_string="{-159102.07503, -38241.843962, 589270.815269}",
    Branch5_Item0_TypeName="Grasshopper.Kernel.Types.GH_String",
    Branch6_Path="{0;6}",
    Branch6_Item0_null_string=False,
    Branch6_Item0_string="{-155401.937474, -38241.516605, 589942.768659}"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)
to_flux_3 = ToFlux(
    Keys=select_from_list_3,
    Value=item_3,
    Mode=flow_control_3,
    isNotificationEnabled=True,
    keyId="40ce1646f0702efe62d8be5431aaa9a1",
    projectId="a6ZAgj3PY5Pqk56N4",
    Branch0_Path="{0;0}",
    Branch0_Item0_null_string=False,
    Branch0_Item0_string="{-155403.397285, -41286.647808, 589307.391185}",
    Branch0_Item0_TypeName="Grasshopper.Kernel.Types.GH_String",
    Branch1_Path="{0;1}",
    Branch1_Item0_null_string=False,
    Branch1_Item0_string="{-153550.773838, -35957.504524, 590755.27846}",
    Branch1_Item0_TypeName="Grasshopper.Kernel.Types.GH_String",
    Branch2_Path="{0;2}",
    Branch2_Item0_null_string=False,
    Branch2_Item0_string="{-155401.207569, -36718.951003, 590260.457397}",
    Branch2_Item0_TypeName="Grasshopper.Kernel.Types.GH_String",
    Branch3_Path="{0;3}",
    Branch3_Item0_null_string=False,
    Branch3_Item0_string="{-155401.207569, -36718.951003, 590260.457397}",
    Branch3_Item0_TypeName="Grasshopper.Kernel.Types.GH_String",
    Branch4_Path="{0;4}",
    Branch4_Item0_null_string=False,
    Branch4_Item0_string="{-153551.503743, -37480.070125, 590437.589723}",
    Branch4_Item0_TypeName="Grasshopper.Kernel.Types.GH_String",
    Branch5_Path="{0;5}",
    Branch5_Item0_null_string=False,
    Branch5_Item0_string="{-157251.641299, -37480.397483, 589765.636333}",
    Branch5_Item0_TypeName="Grasshopper.Kernel.Types.GH_String",
    Branch6_Path="{0;6}",
    Branch6_Item0_null_string=False,
    Branch6_Item0_string="{-157251.641299, -37480.397483, 589765.636333}"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)
flux_2 = FluxProject()  # -> Keys, Meta
