# Dynamo graph Place adaptive components.dyn (Dynamo 0.8.2.2392)

# group: PANEL VERTEXES
code_block = CodeBlock { 3; }

chop = List.Chop(arg1=code_block)

# group: ADAPTIVE COMPONENT FAMILY
family_types = FamilyTypes("Family1:Family1")

byPoints = AdaptiveComponent.ByPoints(chop, family_types)

# group: COORDINATES
file_path = Filename("C:\Users\giovanni.brogioli\Documents\Dynamo\Scripts\Adaptive\coordinates2.csv")

importFromCSV = ImportFromCSV(file_path)
code_block_2 = CodeBlock(a=importFromCSV) { a[0]; }
code_block_3 = CodeBlock(a=importFromCSV) { a[1]; }
code_block_4 = CodeBlock(a=importFromCSV) { a[2]; }
byCoordinates = Point.ByCoordinates(x=code_block_2, y=code_block_3, z=code_block_4)
slabShapeByPoints = Custom[Roof.SlabShapeByPoints]()  # Transform a slab shape based on a list of XYZs. PLEASE NOTE: Will reset any previous edits on the slab shape.
