# Dynamo graph Place adaptive components01.dyn (Dynamo 0.8.2.2392)

# group: COORDINATES
file_path = Filename("C:\Users\giovanni.brogioli\Documents\Dynamo\Scripts\Adaptive\coordinates2.csv")

fromPath = FileObject(file_path)  # "File.FromPath"
code_block = CodeBlock { "coordinates2"; }
code_block_2 = CodeBlock { 0; }
readFromFile = Excel.ReadFromFile(file=fromPath, sheetName=code_block, readAsStrings=code_block_2)
code_block_3 = CodeBlock { ","; }
split = String.Split(readFromFile, code_block_3)
code_block_4 = CodeBlock { 1; }
flatten = List.Flatten(list=split, amt=code_block_4)
code_block_5 = CodeBlock { 0; }
getItemAtIndex = List.GetItemAtIndex(list=flatten, index=code_block_5, lacing=Longest)
toNumber = String.ToNumber(getItemAtIndex)
code_block_6 = CodeBlock { 1; }
getItemAtIndex_2 = List.GetItemAtIndex(list=flatten, index=code_block_6, lacing=Longest)
toNumber_2 = String.ToNumber(getItemAtIndex_2)
code_block_7 = CodeBlock { 2; }
getItemAtIndex_3 = List.GetItemAtIndex(list=flatten, index=code_block_7, lacing=Longest)
toNumber_3 = String.ToNumber(getItemAtIndex_3)
byCoordinates = Point.ByCoordinates(x=toNumber, y=toNumber_2, z=toNumber_3, lacing=Longest)

# group: PANEL VERTEXES
code_block_8 = CodeBlock { 3; }

chop = List.Chop(byCoordinates, code_block_8)

# group: ADAPTIVE COMPONENT FAMILY
family_types = FamilyTypes("Family1:Family1")

byPoints = AdaptiveComponent.ByPoints(chop, family_types)
importFromCSV = ImportFromCSV()
slabShapeByPoints = Custom[Roof.SlabShapeByPoints]()  # Transform a slab shape based on a list of XYZs. PLEASE NOTE: Will reset any previous edits on the slab shape.
flatten_2 = Flatten()
