# Dynamo graph Add View Filters - Links.dyn (Dynamo 1.3.1.1736)

get_revit_activeview = Custom[Get Revit ActiveView]()  # Active View
get_documents = Custom[Get Documents]()  # Queries all linked Revit files and retrieves their Name, LinkInstance and Document properties.
categories = Categories("StructuralFraming")
getFromLinkedFile = Custom[Element.GetFromLinkedFile](Link_Instance=get_documents.Link_Instance, Link_Document=get_documents.Link_Doc, Category=categories)  # Get elements from link document instance based on category
code_block = CodeBlock { "Elevation at Bottom"; }
getParameterValueByName = Element.GetParameterValueByName(element=getFromLinkedFile, parameterName=code_block)
code_block_2 = CodeBlock { 0; }
round = Math.Round(number=getParameterValueByName, digits=code_block_2)
flatten = Flatten(round)
uniqueItems = List.UniqueItems(flatten)
removeNulls = Lists.Manage.RemoveNulls(uniqueItems)
string_from_object = FromObject(removeNulls)
select_rule_type = RuleTypes("Equals")
code_block_3 = CodeBlock(a=removeNulls) { a/304.8; }
select_model_element = DSModelElementSelection()  # 1 picked in the model
parameterByName = Parameter.ParameterByName(element=select_model_element, name=code_block)
byRuleType = Revit.Filter.FilterRule.ByRuleType(select_rule_type, code_block_3, parameterByName@L2, lacing=Longest)
byRules = Revit.Filter.ParameterFilterElement.ByRules(string_from_object, categories, byRuleType)
addFilter = View.AddFilter(get_revit_activeview, byRules)
code_block_4 = CodeBlock(lista=string_from_object) { a = Count(lista); rndColor(0..a); }
fill_patterns = FillPatterns("Solid fill")
byProperties = Revit.Filter.OverrideGraphicSettings.ByProperties(arg1=code_block_4.out1, arg3=code_block_4.out1, arg5=fill_patterns)
code_block_5 = CodeBlock { true; }
setFilterOverrides = View.SetFilterOverrides(view=get_revit_activeview, parameterFilter=byRules, overrides=byProperties, hide=code_block_5)
getParameterValueByName_2 = Element.GetParameterValueByName(parameterName=code_block)  # unwired: element
groupByFunction = GroupByFunction(getFromLinkedFile, getParameterValueByName_2)
categories_2 = Categories("Floors")
getFromLinkedFile_2 = Custom[Element.GetFromLinkedFile](Link_Instance=get_documents.Link_Instance, Link_Document=get_documents.Link_Doc, Category=categories_2)
code_block_6 = CodeBlock { "Elevation at Bottom"; }
getParameterValueByName_3 = Element.GetParameterValueByName(parameterName=code_block_6)  # unwired: element
groupByFunction_2 = GroupByFunction(getFromLinkedFile_2, getParameterValueByName_3)
code_block_7 = CodeBlock { {"Elevation at Top","Elevation at Bottom"}; }
getParameterValueByName_4 = Element.GetParameterValueByName(element=groupByFunction_2, parameterName=code_block_7, lacing=CrossProduct)
code_block_8 = CodeBlock(a=getFromLinkedFile_2) { a[0]; }
parameters = Element.Parameters(code_block_8)
code_block_9 = CodeBlock { def rnd1(){return = Math.Random(0,255); }; def rndColor(x) {return = DSCore.Color.ByARGB(255,rnd1(),rnd1(),rnd1()); }; }
code_block_10 = CodeBlock { 1; }
getUnused = Custom[Filter.GetUnused](Toggle=code_block_10)  # Returns all unused filters in the project so that they can be used. Use in conjunction with 'Tool.Eraser' from the SteamNodes package or 'Delete.Elements' from Grimshaw package.
delete = Archilab.Grimshaw.Elements.Element.Delete()  # unwired: arg0
