# Dynamo graph Add View Filters - Links01.dyn (Dynamo 1.3.1.1736)

# group: SELECT THE CATEGORY TO FILTER
categories = Categories("StructuralFraming")

# group: EXTRACT SELECTED CATEGORIES FROM LINKED REVIT MODEL
get_documents = Custom[Get Documents]()  # Queries all linked Revit files and retrieves their Name, LinkInstance and Document properties.
getFromLinkedFile = Custom[Element.GetFromLinkedFile](Link_Instance=get_documents.Link_Instance, Link_Document=get_documents.Link_Doc, Category=categories)  # Get elements from link document instance based on category

# group: GROUP THE LINKED INSTANCE BY A PARAMETER
code_block = CodeBlock { "Elevation at Bottom"; }
getParameterValueByName = Element.GetParameterValueByName(parameterName=code_block)  # unwired: element
groupByFunction = GroupByFunction(getFromLinkedFile, getParameterValueByName)

# group: CREATE A LIST OF UNIQUE BOTTOM ELEVATIONS VALUES
getParameterValueByName_2 = Element.GetParameterValueByName(element=getFromLinkedFile, parameterName=code_block)
code_block_2 = CodeBlock { 0; }
round = Math.Round(number=getParameterValueByName_2, digits=code_block_2)
flatten = Flatten(round)
uniqueItems = List.UniqueItems(flatten)
removeNulls = Lists.Manage.RemoveNulls(uniqueItems)

string_from_object = FromObject(removeNulls)

# group: SELECT A CATEGORY INSTANCE IN YOUR MODEL
select_model_element = DSModelElementSelection()  # 1 picked in the model

# group: CREATE FILTER RULES FOR SELECTED ELEMENTS
select_rule_type = RuleTypes("Equals")
code_block_3 = CodeBlock(a=removeNulls) { a/304.8; }
parameterByName = Parameter.ParameterByName(element=select_model_element, name=code_block)
byRuleType = Revit.Filter.FilterRule.ByRuleType(select_rule_type, code_block_3, parameterByName@L2, lacing=Longest)

# group: ADD FILTER
get_revit_activeview = Custom[Get Revit ActiveView]()  # Active View
byRules = Revit.Filter.ParameterFilterElement.ByRules(string_from_object, categories, byRuleType)
addFilter = View.AddFilter(get_revit_activeview, byRules)

# group: OVERRIDE COLORS
code_block_4 = CodeBlock(lista=string_from_object) { a = Count(lista); rndColor(0..a); }
fill_patterns = FillPatterns("Solid fill")
byProperties = Revit.Filter.OverrideGraphicSettings.ByProperties(arg1=code_block_4.out1, arg3=code_block_4.out1, arg5=fill_patterns)
code_block_5 = CodeBlock { true; }
setFilterOverrides = View.SetFilterOverrides(view=get_revit_activeview, parameterFilter=byRules, overrides=byProperties, hide=code_block_5)
code_block_6 = CodeBlock { def rnd1(){return = Math.Random(0,255); }; def rndColor(x) {return = DSCore.Color.ByARGB(255,rnd1(),rnd1(),rnd1()); }; }

# group: DELETE FILTERS
code_block_7 = CodeBlock { 1; }
getUnused = Custom[Filter.GetUnused](Toggle=code_block_7)  # Returns all unused filters in the project so that they can be used. Use in conjunction with 'Tool.Eraser' from the SteamNodes package or 'Delete.Elements' from Grimshaw package.
delete = Archilab.Grimshaw.Elements.Element.Delete()  # unwired: arg0

categories_2 = Categories("Floors")

# group: EXTRACT SELECTED CATEGORIES FROM LINKED REVIT MODEL
get_documents_2 = Custom[Get Documents]()
getFromLinkedFile_2 = Custom[Element.GetFromLinkedFile](Link_Instance=get_documents_2.Link_Instance, Link_Document=get_documents_2.Link_Doc, Category=categories_2)

parameters = Element.Parameters(getFromLinkedFile_2)
code_block_8 = CodeBlock(a=getFromLinkedFile) { a[0]; }
intersectsElement = Revit.Element.IntersectsElement(code_block_8, getFromLinkedFile_2, lacing=CrossProduct)
