# Dynamo graph AddFilter.dyn (Dynamo 2.0.2.6826)

# group: Destination template
views = Views(index=62)

# group: Destination template
views_2 = Views(index=65)

list_create = List.Create(item0=views, item1=views_2)

# group: Source template
views_3 = Views(index=9)

filters = View.Filters(view=views_3)
addFilter = View.AddFilter(view=list_create@L2, parameterFilter=filters, lacing=Longest)
