# Dynamo graph AddSharedParameters.dyn (Dynamo 2.2.0.4667)

add_shared_parameter_to_project = Custom[Add Shared Parameter to Project]()  # This node will add a parameter to shared parameter file and then add it to the project.; unwired: parameterName, sharedParameterGroupName, paramerterType, visible, elementCategory, paramterGroup, instance
code_block = CodeBlock()
# ---------- code_block.designscript (63 lines) ----------
["ARUP_BDR_TITLE1",
"ARUP_BDR_TITLE2",
"ARUP_BDR_TITLE3",
"ARUP_BDR_TITLE4",
"ARUP_BDR_ISSUE",
"ARUP_BDR_ROLE",
"ARUP_BDR_STATUS",
"ARUP_BDR_SUITABILITY",
"ARUP_BDR_SUITABILITY_CODE",
"1 - Approved",
"1 - Checked",
"1 - Date",
"1 - Description",
"1 - Drawn By",
"1 - Revision",
"2 - Approved",
"2 - Checked",
"2 - Date",
"2 - Description",
"2 - Drawn By",
"2 - Revision",
"3 - Approved",
"3 - Checked",
"3 - Date",
"3 - Description",
"3 - Drawn By",
"3 - Revision",
"4 - Approved",
"4 - Checked",
"4 - Date",
"4 - Description",
"4 - Drawn By",
"4 - Revision",
"5 - Approved",
"5 - Checked",
"5 - Date",
"5 - Description",
"5 - Drawn By",
"5 - Revision",
"6 - Approved",
"6 - Checked",
"6 - Date",
"6 - Description",
"6 - Drawn By",
"6 - Revision",
"7 - Approved",
"7 - Checked",
"7 - Date",
"7 - Description",
"7 - Drawn By",
"7 - Revision",
"8 - Approved",
"8 - Checked",
"8 - Date",
"8 - Description",
"8 - Drawn By",
"8 - Revision",
"9 - Approved",
"9 - Checked",
"9 - Date",
"9 - Description",
"9 - Drawn By",
"9 - Revision"];
# ----------------------------------------
code_block_2 = CodeBlock { "TitleBlocks"; }
code_block_3 = CodeBlock { "Text"; }
code_block_4 = CodeBlock { [true]; }
code_block_5 = CodeBlock { Category.ByName("Sheets"); }
python_script = Python(IN[0]=code_block, IN[1]=code_block_2, IN[2]=code_block_3, IN[3]=code_block_4, IN[4]=code_block_5)
# ---------- python_script.python (118 lines) ----------
#Copyright(c) 2015, Konrad Sobon
# @arch_laboratory, http://archi-lab.net

import clr
clr.AddReference('ProtoGeometry')
from Autodesk.DesignScript.Geometry import *

# Import DocumentManager and TransactionManager
clr.AddReference("RevitServices")
import RevitServices
from RevitServices.Persistence import DocumentManager
from RevitServices.Transactions import TransactionManager

# Import RevitAPI
clr.AddReference("RevitAPI")
import Autodesk
from Autodesk.Revit.DB import *

doc = DocumentManager.Instance.CurrentDBDocument
uiapp = DocumentManager.Instance.CurrentUIApplication
app = uiapp.Application

from System.Collections.Generic import *

# Import ToDSType(bool) extension method
clr.AddReference("RevitNodes")
import Revit
clr.ImportExtensions(Revit.Elements)
import System
#The inputs to this node will be stored as a list in the IN variable.
dataEnteringNode = IN

_paramName = IN[0]
_groupName = IN[1]
_paramType = IN[2]
_visible = IN[3]
_category = IN[4]
_paramGroup = BuiltInParameterGroup.PG_TEXT
_instance = True

def ParamBindingExists(_doc, _paramName, _paramType):
	map = doc.ParameterBindings
	iterator = map.ForwardIterator()
	iterator.Reset()
	while iterator.MoveNext():
		if iterator.Key != None and iterator.Key.Name == _paramName and iterator.Key.ParameterType == _paramType:
			paramExists = True
			break
		else:
			paramExists = False
	return paramExists

def RemoveParamBinding(_doc, _paramName, _paramType):
	map = doc.ParameterBindings
	iterator = map.ForwardIterator()
	iterator.Reset()
	while iterator.MoveNext():
		if iterator.Key != None and iterator.Key.Name == _paramName and iterator.Key.ParameterType == _paramType:
			definition = iterator.Key
			break
	message = None
	if definition != None:
		map.Remove(definition)
		message = "Success"
	return message

def addParam(doc, _paramName, _visible, _instance, _groupName, _paramGroup):
	message = None
	if ParamBindingExists(doc, _paramName, _paramType):
		if not RemoveParamBinding(doc, _paramName, _paramType) == "Success":
			message = "Param Binding Not Removed Successfully"
		else:
			message = None
			
	group = file.Groups.get_Item(_groupName)
	if group == None:
		group = file.Groups.Create(_groupName)
	if group.Definitions.Contains(group.Definitions.Item[_paramName]):
		_def = group.Definitions.Item[_paramName]
	else:
		_def = group.Definitions.Create(_paramName, _paramType, _visible)
	
	param = doc.ParameterBindings.Insert(_def, bind, _paramGroup)
	
	return message
#"Start" the transaction
TransactionManager.Instance.EnsureInTransaction(doc)

try:
	file = app.OpenSharedParameterFile()
except:
	message = "No Shared Parameter file found."
	pass

builtInCategory = System.Enum.ToObject(BuiltInCategory, _category.Id)
cats = app.Create.NewCategorySet()
cats.Insert(doc.Settings.Categories.get_Item(builtInCategory))
if _instance:
	bind = app.Create.NewInstanceBinding(cats)
else:
	bind = app.Create.NewTypeBinding(cats)


if isinstance(_paramName, list):
	for i in _paramName:
		message = addParam(doc, i, True, True, _groupName, _paramGroup)
else:
	message = addParam(doc, _paramName, _visible, _instance, _groupName, _paramGroup)


# "End" the transaction
TransactionManager.Instance.TransactionTaskDone()

#Assign your output to the OUT variable
if message == None:
	OUT = "Success"
else:
	OUT = message
# ----------------------------------------
