# Dynamo graph AlignSection02.dyn (Dynamo 1.3.1.1736)

# group: Select Section
select_model_element = DSModelElementSelection()

code_block = CodeBlock(a=select_model_element) { a; }

# group: Select the Viewport that belongs to the Section
categories = Categories("Views")
all_elements_of_category = ElementsOfCategory(categories)
removeNulls = Lists.Manage.RemoveNulls(all_elements_of_category)
name = Element.Name(removeNulls)
name_2 = Element.Name(select_model_element)
contains = String.Contains(str=name, searchFor=name_2)
filterByBoolMask = List.FilterByBoolMask(list=removeNulls, mask=contains)
indexOf = IndexOf(all_elements_of_category, select_model_element)

# group: Get View Direction(perpendicular to view line) and View Origin
python_script = Python(IN[0]=filterByBoolMask.in)
# ---------- python_script.python (19 lines) ----------
import clr
clr.AddReference('RevitAPI')
from Autodesk.Revit.DB import *

clr.AddReference("RevitNodes")
import Revit
clr.ImportExtensions(Revit.GeometryConversion)

items = UnwrapElement(IN[0])
dlist = list()
orig = []

for item in items:
	try:
		dlist.append(item.ViewDirection.ToVector())
		orig.append(item.Origin.ToPoint())
	except:
		dlist.append(None)
OUT = dlist, orig
# ----------------------------------------

# group: Select Element to Align To
select_model_element_2 = DSModelElementSelection()

# group: Element direction
getLocation = Element.GetLocation(select_model_element_2)

# group: Find the closest wall end point to the Section Origin
code_block_2 = CodeBlock(a=python_script) { a[1]; }
code_block_3 = CodeBlock { {0,1}; }
pointAtParameter = Curve.PointAtParameter(curve=getLocation, param=code_block_3)
byTwoPoints = Vector.ByTwoPoints(start=code_block_2, end=pointAtParameter, lacing=Longest)
length = Vector.Length(byTwoPoints)
minimumItem = List.MinimumItem(length)
indexOf_2 = IndexOf(length, minimumItem)
getItemAtIndex = List.GetItemAtIndex(list=pointAtParameter, index=indexOf_2)

# group: Translation Vector
byTwoPoints_2 = Vector.ByTwoPoints(start=code_block_2, end=getItemAtIndex)
code_block_4 = CodeBlock(a=byTwoPoints_2) { a[0]; }

# group: Move Section
python_script_2 = Python(IN[0]=code_block, IN[1]=code_block_4)
# ---------- python_script_2.python (30 lines) ----------
import clr
clr.AddReference('RevitAPI')
from Autodesk.Revit.DB import *

import clr
clr.AddReference("RevitServices")
from RevitServices.Persistence import DocumentManager
from RevitServices.Transactions import TransactionManager

clr.AddReference("RevitNodes")
import Revit
clr.ImportExtensions(Revit.GeometryConversion)

doc = DocumentManager.Instance.CurrentDBDocument

section = UnwrapElement(IN[0])

newloc = IN[1].ToXyz(True)

TransactionManager.Instance.EnsureInTransaction(doc)

ElementTransformUtils.MoveElement(doc,section.Id,newloc)

TransactionManager.Instance.TransactionTaskDone()




		
OUT = section
# ----------------------------------------

# group: Get View Alignment
code_block_5 = CodeBlock(a=python_script) { a[0]; }
ZAxis = Vector.ZAxis()
code_block_6 = CodeBlock { 90; }
rotate = Vector.Rotate(code_block_5, ZAxis, code_block_6)

# group: section direction
byStartPointDirectionLength = Line.ByStartPointDirectionLength(startPoint=code_block_2, direction=rotate, length=minimumItem)

# group: Calculate the Angle between the Section Alignment and the wall
direction = Line.Direction(byStartPointDirectionLength)
code_block_7 = CodeBlock(a=direction) { a[0]; }
direction_2 = Line.Direction(getLocation)
python_script_3 = Python(IN[0]=code_block_7, IN[1]=direction_2)
# ---------- python_script_3.python (58 lines) ----------
#Copyright(c) 2014, Nathan Miller
#TheProvingGround.org
import clr
clr.AddReference('ProtoGeometry')
from Autodesk.DesignScript.Geometry import *

import math

#The input to this node will be stored in the IN[0] variable.
vecA = IN[0]
vecB = IN[1]

testA = hasattr(vecA, "__iter__")
testB = hasattr(vecB, "__iter__")

bools = testA + testB

angles = []

origin = Point.ByCoordinates(0,0,0)



#if the input is an array
if bools>0:
	if bools == 2:
		for i in range(0,len(vecA)):
			angle = []
			for j in range(0,len(vecB)):
				arc = Arc.ByCenterPointStartPointEndPoint(origin,Vector.AsPoint(vecA),Vector.AsPoint(vecB))
				a = arc.SweepAngle
				angle.append(a)
			angles.append(angle)
	
	elif hasattr(vecA, "__iter__"):
		for i in range(0,len(vecA)):
			arc = Arc.ByCenterPointStartPointEndPoint(origin,Vector.AsPoint(vecA),Vector.AsPoint(vecB))
			a = arc.SweepAngle
			angles.append(a)
		
	elif hasattr(vecB, "__iter__"):
		angle = []
		for i in range(0,len(vecB)):
			arc = Arc.ByCenterPointStartPointEndPoint(origin,Vector.AsPoint(vecA),Vector.AsPoint(vecB))
			a = arc.SweepAngle
			angles.append(a)
else:
	arc = Arc.ByCenterPointStartPointEndPoint(origin,Vector.AsPoint(vecA),Vector.AsPoint(vecB))
	a = arc.SweepAngle
	angles.append(a)
	
rad = []

for a in angles:
	rad.append(a*math.pi/180)

#Assign your output to the OUT variable
OUT = angles, rad
# ----------------------------------------
code_block_8 = CodeBlock(a=python_script_3) { a[1][0]; }

# group: Rotation Axis
code_block_9 = CodeBlock(a=code_block_2) { Line.ByStartPointEndPoint(a[0],b); b = Autodesk.Point.ByCoordinates(a.X,a.Y,a.Z+10); }  # unwired: b
code_block_10 = CodeBlock(a=code_block_9.out0) { a[0]; }

# group: Rotate Section
python_script_4 = Python(IN[0]=python_script_2, IN[1]=code_block_8, IN[2]=code_block_10)
# ---------- python_script_4.python (35 lines) ----------
import clr
# Import RevitAPI
clr.AddReference("RevitAPI")
import Autodesk
from Autodesk.Revit.DB import *

clr.AddReference("RevitServices")
from RevitServices.Persistence import DocumentManager
from RevitServices.Transactions import TransactionManager

clr.AddReference("RevitNodes")
import Revit
clr.ImportExtensions(Revit.GeometryConversion)


clr.AddReference('ProtoGeometry')
from Autodesk.DesignScript.Geometry import *


doc = DocumentManager.Instance.CurrentDBDocument

section = UnwrapElement(IN[0])

radians = IN[1]

axis = IN[2].ToRevitType()

TransactionManager.Instance.EnsureInTransaction(doc)

ElementTransformUtils.RotateElement(doc, section.Id, axis, radians)

TransactionManager.Instance.TransactionTaskDone()

		
OUT = section
# ----------------------------------------
