# Dynamo graph AlignSection03.dyn (Dynamo 1.3.1.1736)

# group: Select Section
select_model_element = DSModelElementSelection()

# group: Select the Viewport that belongs to the Section
categories = Categories("Views")
all_elements_of_category = ElementsOfCategory(categories)
indexOf = IndexOf(all_elements_of_category, select_model_element)
removeNulls = Lists.Manage.RemoveNulls(all_elements_of_category)
name = Element.Name(removeNulls)
name_2 = Element.Name(select_model_element)
contains = String.Contains(str=name, searchFor=name_2)
filterByBoolMask = List.FilterByBoolMask(list=removeNulls, mask=contains)

code_block = CodeBlock(IN=select_model_element) { IN; }
code_block_2 = CodeBlock { 0; }

# group: Select Element to Align To
# note: Wall centreline
select_model_element_2 = DSModelElementSelection()  # 1 picked in the model

# group: Element direction
getLocation = Element.GetLocation(select_model_element_2)

# group: Get View Direction(perpendicular to view line) and View Origin
python_script = Python(IN[0]=filterByBoolMask.in)
# ---------- python_script.python (19 lines) ----------
import clr
clr.AddReference('RevitAPI')
from Autodesk.Revit.DB import *

clr.AddReference("RevitNodes")
import Revit
clr.ImportExtensions(Revit.GeometryConversion)

items = UnwrapElement(IN[0])
dlist = list()
orig = []

for item in items:
	try:
		dlist.append(item.ViewDirection.ToVector())
		orig.append(item.Origin.ToPoint())
	except:
		dlist.append(None)
OUT = dlist, orig
# ----------------------------------------

code_block_3 = CodeBlock(a=python_script) { a[1]; }
deconstructPoint = Geometry.Points.DeconstructPoint(code_block_3)
endPoint = Curve.EndPoint(getLocation)
code_block_4 = CodeBlock(a=endPoint) { a.Z; }
# note: Section Origin Point
byCoordinates = Point.ByCoordinates(x=deconstructPoint.out0, y=deconstructPoint.out1, z=code_block_4)
closestPointTo = Geometry.ClosestPointTo(geometry=getLocation, other=byCoordinates)
byTwoPoints = Vector.ByTwoPoints(start=closestPointTo, end=byCoordinates)
code_block_5 = CodeBlock(a=byTwoPoints) { a[0]; }

# group: Get View Alignment
code_block_6 = CodeBlock(a=python_script) { a[0]; }
ZAxis = Vector.ZAxis()
code_block_7 = CodeBlock { 90; }
rotate = Vector.Rotate(code_block_6, ZAxis, code_block_7)

code_block_8 = CodeBlock(a=rotate) { a[0]; }
angleBtwVectors = Python(IN[0]=code_block_5, IN[1]=code_block_8)
# ---------- angleBtwVectors.python (58 lines) ----------
#Copyright(c) 2014, Nathan Miller
#TheProvingGround.org
import clr
clr.AddReference('ProtoGeometry')
from Autodesk.DesignScript.Geometry import *

import math

#The input to this node will be stored in the IN[0] variable.
vecA = IN[0]
vecB = IN[1]

testA = hasattr(vecA, "__iter__")
testB = hasattr(vecB, "__iter__")

bools = testA + testB

angles = []

origin = Point.ByCoordinates(0,0,0)



#if the input is an array
if bools>0:
	if bools == 2:
		for i in range(0,len(vecA)):
			angle = []
			for j in range(0,len(vecB)):
				arc = Arc.ByCenterPointStartPointEndPoint(origin,Vector.AsPoint(vecA),Vector.AsPoint(vecB))
				a = arc.SweepAngle
				angle.append(a)
			angles.append(angle)
	
	elif hasattr(vecA, "__iter__"):
		for i in range(0,len(vecA)):
			arc = Arc.ByCenterPointStartPointEndPoint(origin,Vector.AsPoint(vecA),Vector.AsPoint(vecB))
			a = arc.SweepAngle
			angles.append(a)
		
	elif hasattr(vecB, "__iter__"):
		angle = []
		for i in range(0,len(vecB)):
			arc = Arc.ByCenterPointStartPointEndPoint(origin,Vector.AsPoint(vecA),Vector.AsPoint(vecB))
			a = arc.SweepAngle
			angles.append(a)
else:
	arc = Arc.ByCenterPointStartPointEndPoint(origin,Vector.AsPoint(vecA),Vector.AsPoint(vecB))
	a = arc.SweepAngle
	angles.append(a)
	
rad = []

for a in angles:
	rad.append((90-a)*math.pi/180)

#Assign your output to the OUT variable
OUT = angles, rad
# ----------------------------------------
code_block_9 = CodeBlock(a=angleBtwVectors) { a[1][0]; }

# group: Find the closest wall end point to the Section Origin
code_block_10 = CodeBlock(a=code_block_3) { a; }

# group: Rotation Axis
code_block_11 = CodeBlock(a=code_block_10) { Line.ByStartPointEndPoint(a[0],b); b = Autodesk.Point.ByCoordinates(a.X,a.Y,a.Z+10); }  # unwired: b
code_block_12 = CodeBlock(a=code_block_11.out0) { a[0]; }

# group: Rotate Section
python_script_2 = Python(IN[1]=code_block_9, IN[2]=code_block_12)  # unwired: IN[0]
# ---------- python_script_2.python (35 lines) ----------
import clr
# Import RevitAPI
clr.AddReference("RevitAPI")
import Autodesk
from Autodesk.Revit.DB import *

clr.AddReference("RevitServices")
from RevitServices.Persistence import DocumentManager
from RevitServices.Transactions import TransactionManager

clr.AddReference("RevitNodes")
import Revit
clr.ImportExtensions(Revit.GeometryConversion)


clr.AddReference('ProtoGeometry')
from Autodesk.DesignScript.Geometry import *


doc = DocumentManager.Instance.CurrentDBDocument

section = UnwrapElement(IN[0])

radians = IN[1]

axis = IN[2].ToRevitType()

TransactionManager.Instance.EnsureInTransaction(doc)

ElementTransformUtils.RotateElement(doc, section.Id, axis, radians)

TransactionManager.Instance.TransactionTaskDone()

		
OUT = section
# ----------------------------------------

code_block_13 = CodeBlock { A; }  # unwired: A
code_block_14 = CodeBlock(a=getLocation, b=byCoordinates) { Autodesk.Geometry.ClosestPointTo(a,b); }
code_block_15 = CodeBlock(a=code_block_6) { a[0]; }
angleBtwVectors_2 = Python(IN[0]=code_block_15, IN[1]=code_block_5)
# ---------- angleBtwVectors_2.python (58 lines) ----------
#Copyright(c) 2014, Nathan Miller
#TheProvingGround.org
import clr
clr.AddReference('ProtoGeometry')
from Autodesk.DesignScript.Geometry import *

import math

#The input to this node will be stored in the IN[0] variable.
vecA = IN[0]
vecB = IN[1]

testA = hasattr(vecA, "__iter__")
testB = hasattr(vecB, "__iter__")

bools = testA + testB

angles = []

origin = Point.ByCoordinates(0,0,0)



#if the input is an array
if bools>0:
	if bools == 2:
		for i in range(0,len(vecA)):
			angle = []
			for j in range(0,len(vecB)):
				arc = Arc.ByCenterPointStartPointEndPoint(origin,Vector.AsPoint(vecA),Vector.AsPoint(vecB))
				a = arc.SweepAngle
				angle.append(a)
			angles.append(angle)
	
	elif hasattr(vecA, "__iter__"):
		for i in range(0,len(vecA)):
			arc = Arc.ByCenterPointStartPointEndPoint(origin,Vector.AsPoint(vecA),Vector.AsPoint(vecB))
			a = arc.SweepAngle
			angles.append(a)
		
	elif hasattr(vecB, "__iter__"):
		angle = []
		for i in range(0,len(vecB)):
			arc = Arc.ByCenterPointStartPointEndPoint(origin,Vector.AsPoint(vecA),Vector.AsPoint(vecB))
			a = arc.SweepAngle
			angles.append(a)
else:
	arc = Arc.ByCenterPointStartPointEndPoint(origin,Vector.AsPoint(vecA),Vector.AsPoint(vecB))
	a = arc.SweepAngle
	angles.append(a)
	
rad = []

for a in angles:
	rad.append((a)*math.pi/180)

#Assign your output to the OUT variable
OUT = angles, rad
# ----------------------------------------
length = Vector.Length(byTwoPoints)
byStartPointDirectionLength = Line.ByStartPointDirectionLength(startPoint=closestPointTo, direction=byTwoPoints, length=length)
code_block_16 = CodeBlock { 1.63; }
code_block_17 = CodeBlock(a=code_block_16) { a*180/Math.PI; }
code_block_18 = CodeBlock { 90*Math.PI/180; }
