# Dynamo graph AlignSections v08.dyn (Dynamo 0.8.2.2392)

select_model_element = DSModelElementSelection()  # 1 picked in the model
location = StructuralFraming.Location(select_model_element)
select_model_element_2 = DSModelElementSelection()  # 1 picked in the model
python_script = Python(IN[0]=select_model_element_2)
# ---------- python_script.python (36 lines) ----------
import clr
clr.AddReference('RevitAPI')
from Autodesk.Revit.DB import *

clr.AddReference("RevitNodes")
import Revit
clr.ImportExtensions(Revit.GeometryConversion)

clr.AddReference("RevitServices")
import RevitServices
from RevitServices.Persistence import DocumentManager
from RevitServices.Transactions import TransactionManager

doc = DocumentManager.Instance.CurrentDBDocument
views = UnwrapElement(IN[0])

elementlist = list()
failedlist = list()
"""
TransactionManager.Instance.EnsureInTransaction(doc)
for item in views:
	try:
		newmax = item.CropBox.Max.Add(margin)
		newmin = item.CropBox.Min.Subtract(margin)
		newbox = BoundingBoxXYZ()
		newbox.Max = newmax
		newbox.Min = newmin
		item.CropBox = newbox
		elementlist.append(item)
	except:
		elementlist.append(list())
TransactionManager.Instance.TransactionTaskDone()
"""


OUT = ViewDirection(views.Id)
# ----------------------------------------
