# Dynamo graph Change Group Type 2.dyn (Dynamo 0.8.2.2392)

code_block = CodeBlock { "General Notes 1_100 Plan"; }
element_types = ElementTypes("Group")
all_elements_of_type = ElementsOfType(element_types)
filter_by_element_name = Custom[Filter By Element Name](Search_For=code_block, Elements=all_elements_of_type)
code_block_2 = CodeBlock { "B04 CONCOURSE"; }
# note: Element Owner View
python_script = Python(IN[0]=filter_by_element_name.Elements)
# ---------- python_script.python (16 lines) ----------
import clr
clr.AddReference('RevitAPI')
from Autodesk.Revit.DB import *

clr.AddReference("RevitNodes")
import Revit
clr.ImportExtensions(Revit.Elements)

items = UnwrapElement(IN[0])
elementlist = list()
for item in items:
	try:
		elementlist.append(item.Document.GetElement(item.OwnerViewId).ToDSType(True))
	except:
		elementlist.append(list())
OUT = elementlist
# ----------------------------------------
filter_by_element_name_2 = Custom[Filter By Element Name](Search_For=code_block_2, Elements=python_script)
filterByBoolMask = List.FilterByBoolMask(list=filter_by_element_name.Elements, mask=filter_by_element_name_2.bool)
location = Custom[Element.Location](element=filterByBoolMask.in)  # Returns the location of an element as an XYZ (or if it's line-based the start and end point of the line), along with some booleans to help filtering the results. Use this for some element types (e.g. walls or lines) that do not work with the built-in Get Family Instance Location node.
python_script_2 = Python()
# ---------- python_script_2.python (37 lines) ----------
import clr
# Import DocumentManager and TransactionManager
clr.AddReference("RevitServices")
import RevitServices
from RevitServices.Persistence import DocumentManager
from RevitServices.Transactions import TransactionManager

# Import RevitAPI
clr.AddReference("RevitAPI")
import Autodesk
from Autodesk.Revit.DB import *

doc = DocumentManager.Instance.CurrentDBDocument

#The input to this node will be stored in the IN[0]...INX variable(s).

grptype = UnwrapElement(IN[0])
xyz=UnwrapElement(IN[1])

a = xyz.X
b = xyz.Y
c = xyz.Z

d= 0.00328084
elements = []

TransactionManager.Instance.EnsureInTransaction(doc)

elements.append(doc.Create.PlaceGroup(XYZ(a*d,b*d,c*d),grptype[0]))
	
TransactionManager.Instance.TransactionTaskDone()

OUT = elements

	
	
	
# ----------------------------------------
watch = Watch(all_elements_of_type)
code_block_3 = CodeBlock { "General Notes Base Slab 1_100 Plan"; }
element_types_2 = ElementTypes("GroupType")
all_elements_of_type_2 = ElementsOfType(element_types_2)
filter_by_element_name_3 = Custom[Filter By Element Name](Search_For=code_block_3, Elements=all_elements_of_type_2)
flatten = Flatten(filter_by_element_name_3.Elements)
firstItem = List.FirstItem(filterByBoolMask.in)
code_block_4 = CodeBlock { "Type"; }
setParameterByName = Element.SetParameterByName(element=firstItem, parameterName=code_block_4, value=filter_by_element_name_3.Elements)
getParameterValueByName = Element.GetParameterValueByName(element=firstItem, parameterName=code_block_4)
code_block_5 = CodeBlock { "Type"; }
get_built_in_parameter = Custom[Get Built In Parameter](ParameterNames=code_block_5, Elements=all_elements_of_type)
