# Dynamo graph Change Group Type.dyn (Dynamo 0.8.2.2392)

code_block = CodeBlock { 128; }
byARGB = Color.ByARGB(g=code_block)
views = Custom[Document.Views]()  # Gets all views in the document - except for 3D view templates (as long as this bug is not fixed: https://github.com/DynamoDS/Dynamo/issues/2970)
name = Element.Name(views)
string = StringInput("Dependent on RC Sh - B06")
contains = String.Contains(str=name, searchFor=string)
filterByBoolMask = List.FilterByBoolMask(list=views, mask=contains)
name_2 = Element.Name(filterByBoolMask.in)
boolean = BoolSelector(true)
active_view = Custom[Active View](refresh=boolean)
create = List.Create(active_view)
element_types = ElementTypes("Group")
all_elements_of_type = ElementsOfType(element_types)
watch = Watch(all_elements_of_type)
name_3 = Element.Name(watch)
code_block_2 = CodeBlock { "General Notes 1_100 Plan"; }
contains_2 = String.Contains(str=name_3, searchFor=code_block_2)
filterByBoolMask_2 = List.FilterByBoolMask(list=all_elements_of_type, mask=contains_2)
ownerView = Custom[Element.OwnerView](element=filterByBoolMask_2.in)  # Gets the owner view of a given Revit element (if possible)
name_4 = Element.Name(ownerView)
code_block_3 = CodeBlock { "B04 CONCOURSE"; }
contains_3 = String.Contains(str=name_4, searchFor=code_block_3)
filterByBoolMask_3 = List.FilterByBoolMask(list=ownerView, mask=contains_3)
name_5 = Element.Name(filterByBoolMask_3.in)
filterByBoolMask_4 = List.FilterByBoolMask(list=ownerView, mask=contains_3)
name_6 = Element.Name(filterByBoolMask_4.in)
element_types_2 = ElementTypes("GroupType")
all_elements_of_type_2 = ElementsOfType(element_types_2)
code_block_4 = CodeBlock { "General Notes Base Slab 1_100 Plan"; }
filterByName = Custom[Elements.FilterByName](elements=all_elements_of_type_2, searchString=code_block_4)  # Retrieves those elements from a collection whose names match the search string
name_7 = Element.Name(filterByName.in)
firstItem = List.FirstItem(filterByName.in)
location = Custom[Element.Location](element=filterByBoolMask_4.in)  # Returns the location of an element as an XYZ (or if it's line-based the start and end point of the line), along with some booleans to help filtering the results. Use this for some element types (e.g. walls or lines) that do not work with the built-in Get Family Instance Location node.
# note: XYZ
firstItem_2 = List.FirstItem(location.points)
python_script = Python(IN[0]=firstItem, IN[1]=firstItem_2)
# ---------- python_script.python (34 lines) ----------
import clr
# Import DocumentManager and TransactionManager
clr.AddReference("RevitServices")
import RevitServices
from RevitServices.Persistence import DocumentManager
from RevitServices.Transactions import TransactionManager

# Import RevitAPI
clr.AddReference("RevitAPI")
import Autodesk
from Autodesk.Revit.DB import *

doc = DocumentManager.Instance.CurrentDBDocument

#The input to this node will be stored in the IN[0]...INX variable(s).

grptype = UnwrapElement(IN[0])
xyz=UnwrapElement(IN[1])

a = xyz.X
b = xyz.Y
c = xyz.Z

TransactionManager.Instance.EnsureInTransaction(doc)

b=doc.Create.PlaceGroup(XYZ(a,b,c),grptype)
	
TransactionManager.Instance.TransactionTaskDone()

OUT = a

	
	
	
# ----------------------------------------
filterByName_2 = Custom[Elements.FilterByName](elements=name_4, searchString=code_block_3)
