# Dynamo graph Delete Group Type.dyn (Dynamo 0.8.2.2392)

element_types = ElementTypes("Group")
all_elements_of_type = ElementsOfType(element_types)
watch = Watch(all_elements_of_type)
code_block = CodeBlock { "Type"; }
get_built_in_parameter = Custom[Get Built In Parameter](ParameterNames=code_block, Elements=all_elements_of_type)
code_block_2 = CodeBlock { "General Notes 1_100 Plan"; }
filter_by_element_name = Custom[Filter By Element Name](Search_For=code_block_2, Elements=all_elements_of_type)
string = StringInput("B08 LINE 5 BASE SLAB")
python_script = Python(IN[0]=filter_by_element_name.Elements)
# ---------- python_script.python (16 lines) ----------
import clr
clr.AddReference('RevitAPI')
from Autodesk.Revit.DB import *

clr.AddReference("RevitNodes")
import Revit
clr.ImportExtensions(Revit.Elements)

items = UnwrapElement(IN[0])
elementlist = list()
for item in items:
	try:
		elementlist.append(item.Document.GetElement(item.OwnerViewId).ToDSType(True))
	except:
		elementlist.append(list())
OUT = elementlist
# ----------------------------------------
filter_by_element_name_2 = Custom[Filter By Element Name](Search_For=string, Elements=python_script)
filterByBoolMask = List.FilterByBoolMask(list=filter_by_element_name.Elements, mask=filter_by_element_name_2.bool)
bv_erase_or_delete_from_model = Custom[bv Erase or Delete from Model](Element_s=filterByBoolMask.in)  # forked from SteamNodes
