# Dynamo graph Export Hatch Area.dyn (Dynamo 0.8.2.2392)

element_types = ElementTypes("FilledRegion")
all_elements_of_type = ElementsOfType(element_types)
watch = Watch(all_elements_of_type)
python_script = Python(IN[0]=watch)
# ---------- python_script.python (16 lines) ----------
import clr
clr.AddReference('RevitAPI')
from Autodesk.Revit.DB import *

clr.AddReference("RevitNodes")
import Revit
clr.ImportExtensions(Revit.Elements)

items = UnwrapElement(IN[0])
elementlist = list()
for item in items:
	try:
		elementlist.append(item.Document.GetElement(item.OwnerViewId).ToDSType(True))
	except:
		elementlist.append(list())
OUT = elementlist
# ----------------------------------------
name = Element.Name(python_script)
code_block = CodeBlock { "LP"; }
code_block_2 = CodeBlock { 1; }
contains = String.Contains(str=name, searchFor=code_block, ignoreCase=code_block_2)
filterByBoolMask = List.FilterByBoolMask(list=all_elements_of_type, mask=contains)
python_script_2 = Python(IN[0]=filterByBoolMask.in)  # same code as python_script
name_2 = Element.Name(python_script_2)
code_block_3 = CodeBlock { "Mark"; }
code_block_4 = CodeBlock { "Area"; }
getParameterValueByName = Element.GetParameterValueByName(element=filterByBoolMask.in, parameterName=code_block_4)
ceiling = Math.Ceiling(getParameterValueByName)
string_from_object = FromObject(ceiling)
setParameterByName = Element.SetParameterByName(element=filterByBoolMask.in, parameterName=code_block_3, value=string_from_object)
