# Dynamo graph FilledRegion02.dyn (Dynamo 1.3.0.875)

code_block = CodeBlock { {a}; }  # unwired: a
startPoint = Curve.StartPoint(code_block)
python_script = Python(IN[0]=startPoint)  # unwired: IN[1], IN[2]
# ---------- python_script.python (58 lines) ----------
import clr
clr.AddReference('ProtoGeometry')
from Autodesk.DesignScript.Geometry import *

# Import DocumentManager and TransactionManager
clr.AddReference("RevitServices")
import RevitServices
from RevitServices.Persistence import DocumentManager
from RevitServices.Transactions import TransactionManager

# Import RevitAPI
clr.AddReference("RevitAPI")
import Autodesk
from Autodesk.Revit.DB import *

doc = DocumentManager.Instance.CurrentDBDocument
uiapp = DocumentManager.Instance.CurrentUIApplication
app = uiapp.Application

def lineFromCrv(crv):
	start = crv.StartPoint
	end = crv.EndPoint
	a = XYZ(start.X,start.Y,start.Z)
	b = XYZ(end.X,end.Y,end.Z)
	return Autodesk.Revit.DB.Line.CreateBound(a,b)
	
regions = []
activeViewId = doc.ActiveView.Id;

TransactionManager.Instance.EnsureInTransaction(doc)

frt = UnwrapElement( IN[2] )
"""
for bound in IN[0]:
	profileLoops = []
	profileLoop = CurveLoop()
	#create filled region
	for crv in bound:
		profileLoop.Append(lineFromCrv(crv))
	profileLoops.Add(profileLoop)
	region = FilledRegion.Create(doc,frt[0].Id,activeViewId,profileLoops)
	regions.Add(region)
	"""
#End Transaction

stPts = UnwrapElement(IN[0])
endPts = UnwrapElement(IN[1])
profileLoops = []
profileLoop = CurveLoop()
	#create filled region
for i in range(0,len(stPts)):
	for j in range(0,len(stPts[i])):
		profileLoop.Append(Autodesk.Revit.DB.Line.CreateBound(XYZ(stPts[i][j].X,stPts[i][j].Y,stPts[i][j].Z),XYZ(endPts[i][j].X,endPts[i][j].Y,endPts[i][j].Z)))

TransactionManager.Instance.TransactionTaskDone()

#Assign your outputs to the OUT variable
OUT = profileLoop
# ----------------------------------------
get_revit_activeview = Custom[Get Revit ActiveView]()  # Active View
get_revit_activeview_2 = Custom[Get Revit ActiveView]()
select_model_elements = DSModelElementsSelection()  # 4 picked in the model
curves = Element.Curves(select_model_elements)
flatten = Flatten(curves)
endPoint = Curve.EndPoint(flatten)
python_script_2 = Python(IN[0]=endPoint)
# ---------- python_script_2.python (5 lines) ----------
list = IN[0]

list.append(list[0])

OUT = list
# ----------------------------------------
python_script_3 = Python(IN[0]=python_script_2)  # unwired: IN[1]
# ---------- python_script_3.python (61 lines) ----------
import clr
clr.AddReference('ProtoGeometry')
from Autodesk.DesignScript.Geometry import *

# Import DocumentManager and TransactionManager
clr.AddReference("RevitServices")
import RevitServices
from RevitServices.Persistence import DocumentManager
from RevitServices.Transactions import TransactionManager

# Import RevitAPI
clr.AddReference("RevitAPI")
import Autodesk
from Autodesk.Revit.DB import *

doc = DocumentManager.Instance.CurrentDBDocument
uiapp = DocumentManager.Instance.CurrentUIApplication
app = uiapp.Application

def lineFromCrv(crv):
	start = crv.StartPoint
	end = crv.EndPoint
	a = XYZ(start.X,start.Y,start.Z)
	b = XYZ(end.X,end.Y,end.Z)
	return Autodesk.Revit.DB.Line.CreateBound(a,b)
	
regions = []
activeViewId = doc.ActiveView.Id;

TransactionManager.Instance.EnsureInTransaction(doc)

"""
for bound in IN[0]:
	profileLoops = []
	profileLoop = CurveLoop()
	#create filled region
	for crv in bound:
		profileLoop.Append(lineFromCrv(crv))
	profileLoops.Add(profileLoop)
	region = FilledRegion.Create(doc,frt[0].Id,activeViewId,profileLoops)
	regions.Add(region)
	"""
#End Transaction

pts = UnwrapElement(IN[0])
frt = UnwrapElement(IN[1])

profileLoops = []
profileLoop = CurveLoop()
profileLoops.Add(profileLoop)
	#create filled region
for i in range(0,len(pts)-1):
	profileLoop.Append(Autodesk.Revit.DB.Line.CreateBound(XYZ(pts[i].X,pts[i].Y,pts[i].Z),XYZ(pts[i+1].X,pts[i+1].Y,pts[i+1].Z)))

region = FilledRegion.Create(doc,frt[0].Id,activeViewId,profileLoops)
regions.Add(region)

TransactionManager.Instance.TransactionTaskDone()

#Assign your outputs to the OUT variable
OUT = regions
# ----------------------------------------
element_types = ElementTypes("FilledRegionType")
all_elements_of_type = ElementsOfType(element_types)
code_block_2 = CodeBlock(a=all_elements_of_type) { {a[0]}; }
code_block_3 = CodeBlock(a=code_block_2) { a; }
python_script_4 = Python(IN[0]=startPoint, IN[2]=code_block_3)  # unwired: IN[1]
# ---------- python_script_4.python (42 lines) ----------
import clr
clr.AddReference('ProtoGeometry')
from Autodesk.DesignScript.Geometry import *

# Import DocumentManager and TransactionManager
clr.AddReference("RevitServices")
import RevitServices
from RevitServices.Persistence import DocumentManager
from RevitServices.Transactions import TransactionManager

# Import RevitAPI
clr.AddReference("RevitAPI")
import Autodesk
from Autodesk.Revit.DB import *

doc = DocumentManager.Instance.CurrentDBDocument
uiapp = DocumentManager.Instance.CurrentUIApplication
app = uiapp.Application
	
regions = []
activeViewId = doc.ActiveView.Id;

TransactionManager.Instance.EnsureInTransaction(doc)

frt = UnwrapElement( IN[2] )

for bound in IN[0]:
	profileLoops = []
	profileLoop = CurveLoop()
	#create filled region
	for crv in bound:
		profileLoop.Append(lineFromCrv(crv))
	profileLoops.Add(profileLoop)
	region = FilledRegion.Create(doc,frt[0].Id,activeViewId,profileLoops)
	regions.Add(region)
	
#End Transaction

TransactionManager.Instance.TransactionTaskDone()

#Assign your outputs to the OUT variable
OUT = profileLoop
# ----------------------------------------
select_model_elements_2 = DSModelElementsSelection()  # 4 picked in the model
curves_2 = Element.Curves(select_model_elements_2)
flatten_2 = Flatten(curves_2)
endPoint_2 = Curve.EndPoint(flatten_2)
python_script_5 = Python(IN[0]=endPoint_2)  # same code as python_script_2
python_script_6 = Python(IN[0]=python_script_5, IN[1]=python_script_2)  # unwired: IN[2]
# ---------- python_script_6.python (59 lines) ----------
import clr
clr.AddReference('ProtoGeometry')
from Autodesk.DesignScript.Geometry import *

# Import DocumentManager and TransactionManager
clr.AddReference("RevitServices")
import RevitServices
from RevitServices.Persistence import DocumentManager
from RevitServices.Transactions import TransactionManager

# Import RevitAPI
clr.AddReference("RevitAPI")
import Autodesk
from Autodesk.Revit.DB import *

doc = DocumentManager.Instance.CurrentDBDocument
uiapp = DocumentManager.Instance.CurrentUIApplication
app = uiapp.Application

def lineFromCrv(crv):
	start = crv.StartPoint
	end = crv.EndPoint
	a = XYZ(start.X,start.Y,start.Z)
	b = XYZ(end.X,end.Y,end.Z)
	return Autodesk.Revit.DB.Line.CreateBound(a,b)
	
regions = []
activeViewId = doc.ActiveView.Id;

TransactionManager.Instance.EnsureInTransaction(doc)

pts = UnwrapElement(IN[0])
innerPts = UnwrapElement(IN[1])

frt = UnwrapElement(IN[2])

profileLoops = []
outerProfileLoop = CurveLoop()
innerProfileLoop = CurveLoop()

profileLoops.Add(outerProfileLoop)
profileLoops.Add(innerProfileLoop)


#create filled region
for i in range(0,len(pts)-1):
	outerProfileLoop.Append(Autodesk.Revit.DB.Line.CreateBound(XYZ(pts[i].X,pts[i].Y,pts[i].Z),XYZ(pts[i+1].X,pts[i+1].Y,pts[i+1].Z)))

for i in range(0,len(innerPts)-1):
	innerProfileLoop.Append(Autodesk.Revit.DB.Line.CreateBound(XYZ(innerPts[i].X,innerPts[i].Y,innerPts[i].Z),XYZ(innerPts[i+1].X,innerPts[i+1].Y,innerPts[i+1].Z)))


region = FilledRegion.Create(doc,frt[0].Id,activeViewId,profileLoops)
regions.Add(region)

TransactionManager.Instance.TransactionTaskDone()

#Assign your outputs to the OUT variable
OUT = regions, profileLoops
# ----------------------------------------
select_model_elements_3 = DSModelElementsSelection()  # 15 picked in the model
curves_3 = Element.Curves(select_model_elements_3)
flatten_3 = Flatten(curves_3)
group_curves = Custom[Group Curves](Curves=flatten_3)  # This node will take any input of flat list of curves and group them into sublists containing "joinable" curves that is continous curves. They might form closed curves or open curves. Use PolyCurve.ByJoinedCurves to convert output groups of curves into single PolyCurves
endPoint_3 = Curve.EndPoint(group_curves)
# note: Append Pt[0] to the end
python_script_7 = Python(IN[0]=endPoint_3)
# ---------- python_script_7.python (6 lines) ----------
list = IN[0]

for i in range(0,len(list)):
	list[i].append(list[i][0])
	
OUT = list
# ----------------------------------------
python_script_8 = Python(IN[0]=python_script_5, IN[1]=python_script_7, IN[2]=code_block_3)
# ---------- python_script_8.python (56 lines) ----------
import clr
clr.AddReference('ProtoGeometry')
from Autodesk.DesignScript.Geometry import *

# Import DocumentManager and TransactionManager
clr.AddReference("RevitServices")
import RevitServices
from RevitServices.Persistence import DocumentManager
from RevitServices.Transactions import TransactionManager

# Import RevitAPI
clr.AddReference("RevitAPI")
import Autodesk
from Autodesk.Revit.DB import *

doc = DocumentManager.Instance.CurrentDBDocument
uiapp = DocumentManager.Instance.CurrentUIApplication
app = uiapp.Application


regions = []
activeViewId = doc.ActiveView.Id;

TransactionManager.Instance.EnsureInTransaction(doc)

pts = UnwrapElement(IN[0])
innerPts = UnwrapElement(IN[1])

frt = UnwrapElement(IN[2])

profileLoops = []
outerProfileLoop = CurveLoop()
#innerProfileLoop = CurveLoop()

profileLoops.Add(outerProfileLoop)
#profileLoops.Add(innerProfileLoop)


#create filled region
for i in range(0,len(pts)-1):
	outerProfileLoop.Append(Autodesk.Revit.DB.Line.CreateBound(XYZ(pts[i].X,pts[i].Y,pts[i].Z),XYZ(pts[i+1].X,pts[i+1].Y,pts[i+1].Z)))

for j in range(0,len(innerPts)):
	innerProfileLoop = CurveLoop()
	profileLoops.Add(innerProfileLoop)
	for i in range(0,len(innerPts[j])-1):
		innerProfileLoop.Append(Autodesk.Revit.DB.Line.CreateBound(XYZ(innerPts[j][i].X,innerPts[j][i].Y,innerPts[j][i].Z),XYZ(innerPts[j][i+1].X,innerPts[j][i+1].Y,innerPts[j][i+1].Z)))


region = FilledRegion.Create(doc,frt[0].Id,activeViewId,profileLoops)
regions.Add(region)

TransactionManager.Instance.TransactionTaskDone()

#Assign your outputs to the OUT variable
OUT = regions
# ----------------------------------------
