# Dynamo graph FilledRegion03.dyn (Dynamo 1.3.0.875)

# group: OUTER CURVES
select_model_elements = DSModelElementsSelection()  # 10 picked in the model
curves = Element.Curves(select_model_elements)
flatten = Flatten(curves)

group_curves = Custom[Group Curves](Curves=flatten)  # This node will take any input of flat list of curves and group them into sublists containing "joinable" curves that is continous curves. They might form closed curves or open curves. Use PolyCurve.ByJoinedCurves to convert output groups of curves into single PolyCurves

# group (continued): OUTER CURVES
endPoint = Curve.EndPoint(group_curves)

flatten_2 = Flatten(endPoint)

# group (continued): OUTER CURVES
python_script = Python(IN[0]=flatten_2)
# ---------- python_script.python (5 lines) ----------
list = IN[0]

list.append(list[0])

OUT = list
# ----------------------------------------

code_block = CodeBlock { 0.003281; }
scale = Geometry.Scale(geometry=python_script, amount=code_block)

# group: INNER CURVES
select_model_elements_2 = DSModelElementsSelection()  # 21 picked in the model
curves_2 = Element.Curves(select_model_elements_2)
flatten_3 = Flatten(curves_2)
group_curves_2 = Custom[Group Curves](Curves=flatten_3)
endPoint_2 = Curve.EndPoint(group_curves_2)
# note: Append Pt[0] to the end
python_script_2 = Python(IN[0]=endPoint_2)
# ---------- python_script_2.python (6 lines) ----------
list = IN[0]

for i in range(0,len(list)):
	list[i].append(list[i][0])
	
OUT = list
# ----------------------------------------

scale_2 = Geometry.Scale(geometry=python_script_2, amount=code_block)

# group: FILLED REGION TYPE
element_types = ElementTypes("FilledRegionType")
all_elements_of_type = ElementsOfType(element_types)
code_block_2 = CodeBlock(a=all_elements_of_type) { {a[0]}; }
code_block_3 = CodeBlock(a=code_block_2) { a; }

python_script_3 = Python(IN[0]=scale, IN[1]=scale_2, IN[2]=code_block_3)
# ---------- python_script_3.python (57 lines) ----------
import clr
clr.AddReference('ProtoGeometry')
from Autodesk.DesignScript.Geometry import *

# Import DocumentManager and TransactionManager
clr.AddReference("RevitServices")
import RevitServices
from RevitServices.Persistence import DocumentManager
from RevitServices.Transactions import TransactionManager

# Import RevitAPI
clr.AddReference("RevitAPI")
import Autodesk
from Autodesk.Revit.DB import *

doc = DocumentManager.Instance.CurrentDBDocument
uiapp = DocumentManager.Instance.CurrentUIApplication
app = uiapp.Application


regions = []
activeViewId = doc.ActiveView.Id;

TransactionManager.Instance.EnsureInTransaction(doc)

pts = UnwrapElement(IN[0])
innerPts = UnwrapElement(IN[1])

frt = UnwrapElement(IN[2])


profileLoops = []
outerProfileLoop = CurveLoop()
#innerProfileLoop = CurveLoop()

profileLoops.Add(outerProfileLoop)
#profileLoops.Add(innerProfileLoop)


#create filled region
for i in range(0,len(pts)-1):
	outerProfileLoop.Append(Autodesk.Revit.DB.Line.CreateBound(XYZ(pts[i].X,pts[i].Y,pts[i].Z),XYZ(pts[i+1].X,pts[i+1].Y,pts[i+1].Z)))

for j in range(0,len(innerPts)):
	innerProfileLoop = CurveLoop()
	profileLoops.Add(innerProfileLoop)
	for i in range(0,len(innerPts[j])-1):
		innerProfileLoop.Append(Autodesk.Revit.DB.Line.CreateBound(XYZ(innerPts[j][i].X,innerPts[j][i].Y,innerPts[j][i].Z),XYZ(innerPts[j][i+1].X,innerPts[j][i+1].Y,innerPts[j][i+1].Z)))


region = FilledRegion.Create(doc,frt[0].Id,activeViewId,profileLoops)
regions.Add(region)

TransactionManager.Instance.TransactionTaskDone()

#Assign your outputs to the OUT variable
OUT = regions
# ----------------------------------------
