# Dynamo graph FilledRegionSetLineStyle.dyn (Dynamo 1.3.1.1736)

select_model_element = DSModelElementSelection()
categories = Categories("DetailComponents")
all_elements_of_category = ElementsOfCategory(categories)
code_block = CodeBlock { "Type"; }
getParameterValueByName = Element.GetParameterValueByName(element=all_elements_of_category, parameterName=code_block)
name = Element.Name(getParameterValueByName)
removeNulls = Lists.Manage.RemoveNulls(name)
removeItemAtIndex = List.RemoveItemAtIndex(list=all_elements_of_category, indices=removeNulls.out1)
removeItemAtIndex_2 = List.RemoveItemAtIndex(list=name, indices=removeNulls.out1)

# group: Filled region name
code_block_2 = CodeBlock { "Solid Grey"; }

containsItem = List.ContainsItem(list=removeItemAtIndex_2, item=code_block_2, lacing=Longest)
filterByBoolMask = List.FilterByBoolMask(list=removeItemAtIndex, mask=containsItem)
get_all_line_styles = Python()
# ---------- get_all_line_styles.python (24 lines) ----------
import clr
# import Document Manager
clr.AddReference("RevitServices")
import RevitServices 
from RevitServices.Persistence import DocumentManager
from RevitServices.Transactions import TransactionManager
doc = DocumentManager.Instance.CurrentDBDocument
uidoc = DocumentManager.Instance.CurrentUIDocument
clr.AddReference("RevitNodes")
import Revit
clr.ImportExtensions(Revit.Elements)
clr.ImportExtensions(Revit.GeometryConversion)
clr.AddReference("RevitAPI")
from Autodesk.Revit.DB import *


coll = FilteredElementCollector(doc).OfClass(GraphicsStyle).ToElementIds()

elements = []

for c in coll:
	elements.append(doc.GetElement(c))

OUT = elements
# ----------------------------------------
name_2 = Element.Name(get_all_line_styles)

# group: Set Line Style
code_block_3 = CodeBlock { "Thin Lines"; }

firstIndexOf = List.FirstIndexOf(list=name_2, item=code_block_3)
getItemAtIndex = List.GetItemAtIndex(list=get_all_line_styles, index=firstIndexOf)
python_script = Python(IN[0]=filterByBoolMask.in, IN[1]=getItemAtIndex)
# ---------- python_script.python (33 lines) ----------
import clr
clr.AddReference('ProtoGeometry')
from Autodesk.DesignScript.Geometry import *

# Import DocumentManager and TransactionManager
clr.AddReference("RevitServices")
import RevitServices
from RevitServices.Persistence import DocumentManager
from RevitServices.Transactions import TransactionManager

# Import RevitAPI
clr.AddReference("RevitAPI")
import Autodesk
from Autodesk.Revit.DB import *

doc = DocumentManager.Instance.CurrentDBDocument
uiapp = DocumentManager.Instance.CurrentUIApplication
app = uiapp.Application


region = UnwrapElement(IN[0])

ids = UnwrapElement(IN[1])

TransactionManager.Instance.EnsureInTransaction(doc)

for r in region:
	FilledRegion.SetLineStyleId(r, ids.Id)

TransactionManager.Instance.TransactionTaskDone()

#Assign your outputs to the OUT variable
OUT = region
# ----------------------------------------

# group: Select Filled Regions
select_model_elements = DSModelElementsSelection()

code_block_4 = CodeBlock { "<Invisible lines>"; }
