# Dynamo graph Home.dyn (Dynamo 0.8.2.2392)

code_block = CodeBlock { "Type"; }
element_types = ElementTypes("GroupType")
all_elements_of_type = ElementsOfType(element_types)
code_block_2 = CodeBlock { 0; }
getItemAtIndex = List.GetItemAtIndex(list=all_elements_of_type, index=code_block_2)
setParameterByName = Element.SetParameterByName(parameterName=code_block, value=getItemAtIndex)
watch = Watch(all_elements_of_type)
element_setparameterbyname_case = Custom[Element.SetParameterByName(CaSe iNSeNSiTiVe)]()  # Set one of the element's parameters. (CaSe iNSeNSiTiVe)
element_types_2 = ElementTypes("Group")
all_elements_of_type_2 = ElementsOfType(element_types_2)
getparametervaluebyname = Custom[GetParameterValueByName(TypeOrInstance)](element=all_elements_of_type_2, parameterName=code_block)  # Gets a parameter value by name regardless of type or instance.
python_script = Python(IN[0]=all_elements_of_type_2, IN[1]=code_block)
# ---------- python_script.python (14 lines) ----------
import clr
clr.AddReference('ProtoGeometry')
from Autodesk.DesignScript.Geometry import *
#The inputs to this node will be stored as a list in the IN variables.
dataEnteringNode = IN

items = UnwrapElement(IN[0])
parameternamn = IN[1]

elementlist = list()
for item in items:
	elementlist.append(item.LookupParameter(parameternamn).AsString())

OUT = (elementlist)
# ----------------------------------------
getParameterValueByName = Element.GetParameterValueByName(parameterName=code_block)
map = List.Map(list=all_elements_of_type_2, f_x=getParameterValueByName)
