# Dynamo graph Pile Marks.dyn (Dynamo 1.2.3.592)

family_types = FamilyTypes("STR-Conc-Insitu Pile Circular:300 Dia")
family_types_2 = FamilyTypes("STR-Conc-Insitu Pile Circular:600 Dia")
family_types_3 = FamilyTypes("STR-Conc-Insitu Pile Circular:750 Dia")
family_types_4 = FamilyTypes("STR-Conc-Insitu Pile Circular:900 Dia")
join = List.Join(family_types, family_types_2, family_types_3, family_types_4, lacing=Longest)
all_elements_of_family_type = ElementsOfFamilyType(join)
flatten = Flatten(all_elements_of_family_type)
code_block = CodeBlock { "Mark"; }
count = List.Count(flatten)
code_block_2 = CodeBlock(input=count) { 1..input; }
string_from_object = FromObject(code_block_2)
code_block_3 = CodeBlock { 3; }
code_block_4 = CodeBlock { "0"; }
padLeft = String.PadLeft(string_from_object, code_block_3, code_block_4)
code_block_5 = CodeBlock(input=padLeft) { "RA"+input; }
setParameterByName = Element.SetParameterByName(element=flatten, parameterName=code_block, value=code_block_5)
categories = Categories("StructuralFoundation")
all_elements_of_category = ElementsOfCategory(categories)
watch = Watch(all_elements_of_category)
types = Family.Types()  # unwired: arg0
typeName = Custom[Element.TypeName]()  # Get Type Name as string; unwired: Element
groupByKey = List.GroupByKey()  # unwired: list, keys
groupListOfListsByKey = Custom[List.GroupListOfListsByKey]()  # Groups a list of lists by one of its keys; unwired: seq
groupListOfListsByKey_2 = Custom[List.GroupListOfListsByKey]()  # unwired: seq
