# Dynamo graph Tag Override.dyn (Dynamo 0.8.2.2392)

element_types = ElementTypes("IndependentTag")
all_elements_of_type = ElementsOfType(element_types)
watch = Watch(all_elements_of_type)
name = Element.Name(watch)
code_block = CodeBlock { "Release"; }
contains = String.Contains(str=name, searchFor=code_block)
filterByBoolMask = List.FilterByBoolMask(list=all_elements_of_type, mask=contains)
code_block_2 = CodeBlock { 128; }
byARGB = Color.ByARGB(g=code_block_2)
boolean = BoolSelector(true)
active_view = Custom[Active View](refresh=boolean)
create = List.Create(active_view)
python_script = Python(IN[0]=filterByBoolMask.in, IN[1]=byARGB, IN[2]=create)
# ---------- python_script.python (65 lines) ----------
# Created by DPSDesign, dpsdesign.org
import clr
clr.AddReference('ProtoGeometry')
from Autodesk.DesignScript.Geometry import *

# Import ToDSType(bool) extension method
clr.AddReference("RevitNodes")
import Revit
clr.ImportExtensions(Revit.Elements)

# Import DocumentManager and TransactionManager
clr.AddReference("RevitServices")
import RevitServices
from RevitServices.Persistence import DocumentManager
from RevitServices.Transactions import TransactionManager

from System.Collections.Generic import *

# Import RevitAPI
clr.AddReference("RevitAPI")
import Autodesk

doc = DocumentManager.Instance.CurrentDBDocument
uiapp = DocumentManager.Instance.CurrentUIApplication
app = uiapp.Application

#The inputs to this node will be stored as a list in the IN variable.
dataEnteringNode = IN

#unwrap all elements to use with API
elements = []
for i in IN[0]:
	elements.append(UnwrapElement(i))

views = []
for i in IN[2]:
	views.append(UnwrapElement(i))

#create graphic overrides properties
gSettings = Autodesk.Revit.DB.OverrideGraphicSettings()
#deconstruct DS Color Object and convert to RevitAPI color
dsColor = IN[1]
colRed = dsColor.Red
colGreen = dsColor.Green
colBlue = dsColor.Blue
color = Autodesk.Revit.DB.Color(colRed, colGreen, colBlue)
#set Projection Line color
gSettings.SetProjectionLineColor(color)

# "Start" the transaction
TransactionManager.Instance.EnsureInTransaction(doc)

listId = []
#apply color override to elements in an input list
for i in elements:
	listId.append(i.Id)
	id = i.Id
	for j in range(0,len(views)):
		views[j].SetElementOverrides(id, gSettings)

# "End" the transaction
TransactionManager.Instance.TransactionTaskDone()

#Assign your output to the OUT variable
OUT = listId
# ----------------------------------------
ownerView = Custom[Element.OwnerView](element=filterByBoolMask.in)  # Gets the owner view of a given Revit element (if possible)
categories = Categories("DetailComponentTags")
all_elements_of_category = ElementsOfCategory(categories)
views = Custom[Document.Views]()  # Gets all views in the document - except for 3D view templates (as long as this bug is not fixed: https://github.com/DynamoDS/Dynamo/issues/2970)
name_2 = Element.Name(views)
string = StringInput("Dependent on RC Sh - B06")
contains_2 = String.Contains(str=name_2, searchFor=string)
filterByBoolMask_2 = List.FilterByBoolMask(list=views, mask=contains_2)
name_3 = Element.Name(filterByBoolMask_2.in)
