# Dynamo graph overrideCadLayer.dyn (Dynamo 1.3.1.1736)

overrideInView = Element.OverrideInView()  # unwired: element, overrides
reportInstances = CAD.ReportInstances()
code_block = CodeBlock(a=reportInstances.out1) { a; }
layerNames = CAD.LayerNames(code_block)
code_block_2 = CodeBlock { "D"; }
contains = String.Contains(str=layerNames, searchFor=code_block_2)
filterByBoolMask = List.FilterByBoolMask(list=layerNames, mask=contains, lacing=Longest)
code_block_3 = CodeBlock(a=filterByBoolMask.in) { a; }
code_block_4 = CodeBlock { 2; }
green = Custom[Color.Green]()  # Returns the colour green.
blue = Custom[Color.Blue]()  # Returns the colour blue.
aqua = Custom[Color.Aqua]()  # Returns the colour aqua.
code_block_5 = CodeBlock(a=green, b=blue, c=aqua) { {a,b,c}; }
setObjectStyle = CAD.SetObjectStyle(code_block, code_block_3, code_block_4, code_block_5)
select_model_element = DSModelElementSelection()
layerNames_2 = CAD.LayerNames(select_model_element)
code_block_6 = CodeBlock(a=layerNames_2) { a[13]; }
code_block_7 = CodeBlock { "0"; }
allIndicesOf = List.AllIndicesOf(list=layerNames, item=code_block_7, lacing=Longest)
getItemAtIndex = List.GetItemAtIndex(list=layerNames, index=allIndicesOf, lacing=Longest)
code_block_8 = CodeBlock(a=reportInstances.out0) { a; }
