# Dynamo graph Automatic Dimension02.dyn (Dynamo 1.3.1.1736)

# group: DIM. LINES
select_model_elements = DSModelElementsSelection()

python_script = Python(IN[0]=select_model_elements)
# ---------- python_script.python (55 lines) ----------
import clr
clr.AddReference('RevitAPI')
from Autodesk.Revit.DB import *

clr.AddReference("RevitNodes")
import Revit
clr.ImportExtensions(Revit.Elements)
clr.ImportExtensions(Revit.GeometryConversion)

clr.AddReference("RevitServices")
import RevitServices
from RevitServices.Persistence import DocumentManager
from RevitServices.Transactions import TransactionManager

doc = DocumentManager.Instance.CurrentDBDocument

if isinstance(IN[0], list):
	lines = []
	for i in IN[0]:
		lines.append(UnwrapElement(i))
else:
	lines = [UnwrapElement(IN[0])]


crvs = []

for line in lines:
	crvs.append(line.GeometryCurve)
	

#grids = UnwrapElement(IN[1])

"""gridRef = ReferenceArray()
opt = Options()
opt.ComputeReferences = True
opt.IncludeNonVisibleObjects = True
opt.View = doc.ActiveView
for grid in grids:
	for obj in grid.get_Geometry(opt):
		if isinstance(obj, Line):
			gline = obj
			gridRef.Append(gline.Reference)"""

TransactionManager.Instance.EnsureInTransaction(doc)


for crv in crvs:
	ref = ReferenceArray()
	ref.Append(crv.GetEndPointReference(0))
	ref.Append(crv.GetEndPointReference(1))
	dim = doc.Create.NewDimension(doc.ActiveView, crv, ref)

TransactionManager.Instance.TransactionTaskDone()

OUT = dim
# ----------------------------------------

# group: DIM. GRIDLINES
select_model_elements_2 = DSModelElementsSelection()

curve = Grid.Curve(select_model_elements_2)
startPoint = Curve.StartPoint(curve)
firstItem = List.FirstItem(startPoint)
lastItem = List.LastItem(startPoint)
byStartPointEndPoint = Line.ByStartPointEndPoint(startPoint=firstItem, endPoint=lastItem)
code_block = CodeBlock { 500; }
offset = Curve.Offset(curve=byStartPointEndPoint, distance=code_block)
python_script_2 = Python(IN[0]=offset, IN[1]=select_model_elements_2)
# ---------- python_script_2.python (37 lines) ----------
import clr
clr.AddReference('RevitAPI')
from Autodesk.Revit.DB import *

clr.AddReference("RevitNodes")
import Revit
clr.ImportExtensions(Revit.Elements)
clr.ImportExtensions(Revit.GeometryConversion)

clr.AddReference("RevitServices")
import RevitServices
from RevitServices.Persistence import DocumentManager
from RevitServices.Transactions import TransactionManager

doc = DocumentManager.Instance.CurrentDBDocument

line = IN[0].ToRevitType()
grids = UnwrapElement(IN[1])

gridRef = ReferenceArray()
opt = Options()
opt.ComputeReferences = True
opt.IncludeNonVisibleObjects = True
opt.View = doc.ActiveView
for grid in grids:
	for obj in grid.get_Geometry(opt):
		if isinstance(obj, Line):
			gline = obj
			gridRef.Append(gline.Reference)

TransactionManager.Instance.EnsureInTransaction(doc)

dim = doc.Create.NewDimension(doc.ActiveView, line, gridRef)

TransactionManager.Instance.TransactionTaskDone()

OUT = dim
# ----------------------------------------

# group: DIM. LINES w/ OFFSET
select_model_element = DSModelElementSelection()  # 1 picked in the model

curves = Element.Curves(select_model_element)
code_block_2 = CodeBlock { 500; }
offset_2 = Curve.Offset(curve=curves, distance=code_block_2)
python_script_3 = Python(IN[0]=select_model_element, IN[1]=offset_2)
# ---------- python_script_3.python (71 lines) ----------
import clr
clr.AddReference('RevitAPI')
from Autodesk.Revit.DB import *

clr.AddReference("RevitNodes")
import Revit
clr.ImportExtensions(Revit.Elements)
clr.ImportExtensions(Revit.GeometryConversion)

clr.AddReference("RevitServices")
import RevitServices
from RevitServices.Persistence import DocumentManager
from RevitServices.Transactions import TransactionManager

doc = DocumentManager.Instance.CurrentDBDocument

if isinstance(IN[0], list):
	lines = []
	for i in IN[0]:
		lines.append(UnwrapElement(i))
else:
	lines = [UnwrapElement(IN[0])]


crvs = []

for line in lines:
	crvs.append(line.GeometryCurve)




if isinstance(IN[1], list):
	linea = []
	for i in IN[1]:
		linea.append(UnwrapElement(i).ToRevitType())
else:
	linea = [UnwrapElement(IN[1]).ToRevitType()]
"""
refln = []

for ln in linea:
	refln.append(ln.ToRevitType())
"""	


#grids = UnwrapElement(IN[1])

"""gridRef = ReferenceArray()
opt = Options()
opt.ComputeReferences = True
opt.IncludeNonVisibleObjects = True
opt.View = doc.ActiveView
for grid in grids:
	for obj in grid.get_Geometry(opt):
		if isinstance(obj, Line):
			gline = obj
			gridRef.Append(gline.Reference)"""

TransactionManager.Instance.EnsureInTransaction(doc)


for crv in crvs:
	ref = ReferenceArray()
	ref.Append(crv.GetEndPointReference(0))
	ref.Append(crv.GetEndPointReference(1))
	dim = doc.Create.NewDimension(doc.ActiveView, linea[0], ref)

TransactionManager.Instance.TransactionTaskDone()

OUT = linea
# ----------------------------------------
watch = Watch(select_model_elements)

# group: DIM. MULTIPLE LINES W/ OFFSET
select_model_elements_3 = DSModelElementsSelection()  # 1 picked in the model

curves_2 = Element.Curves(select_model_elements_3)
code_block_3 = CodeBlock { 500; }

# group: from Wombat
smartOffset = WombatDynamo.Curve.SmartOffset(curves_2, code_block_3)

flatten = Flatten(smartOffset)
python_script_4 = Python(IN[0]=select_model_elements_3, IN[1]=flatten)
# ---------- python_script_4.python (52 lines) ----------
import clr
clr.AddReference('RevitAPI')
from Autodesk.Revit.DB import *

clr.AddReference("RevitNodes")
import Revit
clr.ImportExtensions(Revit.Elements)
clr.ImportExtensions(Revit.GeometryConversion)

clr.AddReference("RevitServices")
import RevitServices
from RevitServices.Persistence import DocumentManager
from RevitServices.Transactions import TransactionManager

doc = DocumentManager.Instance.CurrentDBDocument

if isinstance(IN[0], list):
	lines = []
	for i in IN[0]:
		lines.append(UnwrapElement(i))
else:
	lines = [UnwrapElement(IN[0])]


crvs = []

for line in lines:
	crvs.append(line.GeometryCurve)


if isinstance(IN[1], list):
	linea = []
	for i in IN[1]:
		linea.append(UnwrapElement(i).ToRevitType())
else:
	linea = [UnwrapElement(IN[1]).ToRevitType()]


TransactionManager.Instance.EnsureInTransaction(doc)


for i in range (0,len(linea)):
	ref = ReferenceArray()
	ref.Append(crvs[i].GetEndPointReference(0))
	ref.Append(crvs[i].GetEndPointReference(1))
	dim = doc.Create.NewDimension(doc.ActiveView, linea[i], ref)



TransactionManager.Instance.TransactionTaskDone()

OUT = linea
# ----------------------------------------
select_model_element_2 = DSModelElementSelection()  # 1 picked in the model
select_model_element_3 = DSModelElementSelection()  # 1 picked in the model
location = Custom[Element.Location]()  # Returns the location of an element as an XYZ (or if it's line-based the start and end point of the line), along with some booleans to help filtering the results. Use this for some element types (e.g. walls or lines) that do not work with the built-in Get Family Instance Location node.; unwired: element
location_2 = Custom[Element.Location]()  # unwired: element
byStartPointEndPoint_2 = Line.ByStartPointEndPoint(startPoint=location.points, endPoint=location_2.points)
byCurve = ModelCurve.ByCurve(byStartPointEndPoint_2)
code_block_4 = CodeBlock { 500; }
smartOffset_2 = WombatDynamo.Curve.SmartOffset(byStartPointEndPoint_2, code_block_4)
python_script_5 = Python(IN[0]=byCurve, IN[1]=smartOffset_2)
# ---------- python_script_5.python (79 lines) ----------
import clr
clr.AddReference('RevitAPI')
from Autodesk.Revit.DB import *

clr.AddReference("RevitNodes")
import Revit
clr.ImportExtensions(Revit.Elements)
clr.ImportExtensions(Revit.GeometryConversion)

clr.AddReference("RevitServices")
import RevitServices
from RevitServices.Persistence import DocumentManager
from RevitServices.Transactions import TransactionManager

doc = DocumentManager.Instance.CurrentDBDocument

if isinstance(IN[0], list):
	lines = []
	for i in IN[0]:
		lines.append(UnwrapElement(i))
else:
	lines = [UnwrapElement(IN[0])]


crvs = []

for line in lines:
	crvs.append(line.GeometryCurve)


if isinstance(IN[1], list):
	linea = []
	for i in IN[1]:
		linea.append(UnwrapElement(i).ToRevitType())
else:
	linea = [UnwrapElement(IN[1]).ToRevitType()]
"""
refln = []

for ln in linea:
	refln.append(ln.ToRevitType())
"""	


#grids = UnwrapElement(IN[1])

"""gridRef = ReferenceArray()
opt = Options()
opt.ComputeReferences = True
opt.IncludeNonVisibleObjects = True
opt.View = doc.ActiveView
for grid in grids:
	for obj in grid.get_Geometry(opt):
		if isinstance(obj, Line):
			gline = obj
			gridRef.Append(gline.Reference)"""

TransactionManager.Instance.EnsureInTransaction(doc)
"""

for crv in crvs:
	ref = ReferenceArray()
	ref.Append(crv.GetEndPointReference(0))
	ref.Append(crv.GetEndPointReference(1))
	for i in range (0,len(linea)):
		dim = doc.Create.NewDimension(doc.ActiveView, linea[i], ref)
"""

for i in range (0,len(linea)):
	ref = ReferenceArray()
	ref.Append(crvs[i].GetEndPointReference(0))
	ref.Append(crvs[i].GetEndPointReference(1))
	dim = doc.Create.NewDimension(doc.ActiveView, linea[i], ref)



TransactionManager.Instance.TransactionTaskDone()

OUT = linea
# ----------------------------------------
select_model_elements_4 = DSModelElementsSelection()
geometry = Element.Geometry(select_model_elements_4)
explode = Geometry.Explode(geometry)
area = Surface.Area(explode)
maximumItem = List.MaximumItem(area)
indexOf = IndexOf(area, maximumItem, lacing=Longest)
getItemAtIndex = List.GetItemAtIndex(list=explode, index=indexOf, lacing=Longest)
perimeterCurves = Surface.PerimeterCurves(getItemAtIndex)
flatten_2 = Flatten(perimeterCurves)
code_block_5 = CodeBlock(a=select_model_elements_4) { {a}; }

# group: reference
python_script_6 = Python(IN[0]=code_block_5)
# ---------- python_script_6.python (45 lines) ----------
import clr
clr.AddReference('RevitAPI')
from Autodesk.Revit.DB import *

clr.AddReference("RevitNodes")
import Revit
clr.ImportExtensions(Revit.Elements)
clr.ImportExtensions(Revit.GeometryConversion)

clr.AddReference("RevitServices")
import RevitServices
from RevitServices.Persistence import DocumentManager
from RevitServices.Transactions import TransactionManager

doc = DocumentManager.Instance.CurrentDBDocument
uiapp = DocumentManager.Instance.CurrentUIApplication
app = uiapp.Application

if isinstance(IN[0], list):
	lines = []
	for i in IN[0]:
		lines.append(UnwrapElement(i))
else:
	lines = [UnwrapElement(IN[0])]
	
opt = app.Create.NewGeometryOptions()
opt.ComputeReferences = 1
opt.IncludeNonVisibleObjects = 1
opt.View = doc.ActiveView


lines = UnwrapElement(IN[0])

edgeArray = []



for r in lines:
	geomElem = r.get_Geometry(opt)
	enum1 = geomElem.GetEnumerator() ; enum1.MoveNext()
	geo2 = enum1.Current
	edgeArray.append(geo2.Edges)
	

OUT = edgeArray[0][5].GetEndPointReference(0)
# ----------------------------------------

# group: reference edges
python_script_7 = Python(IN[0]=code_block_5)
# ---------- python_script_7.python (45 lines) ----------
import clr
clr.AddReference('RevitAPI')
from Autodesk.Revit.DB import *

clr.AddReference("RevitNodes")
import Revit
clr.ImportExtensions(Revit.Elements)
clr.ImportExtensions(Revit.GeometryConversion)

clr.AddReference("RevitServices")
import RevitServices
from RevitServices.Persistence import DocumentManager
from RevitServices.Transactions import TransactionManager

doc = DocumentManager.Instance.CurrentDBDocument
uiapp = DocumentManager.Instance.CurrentUIApplication
app = uiapp.Application

if isinstance(IN[0], list):
	lines = []
	for i in IN[0]:
		lines.append(UnwrapElement(i))
else:
	lines = [UnwrapElement(IN[0])]
	
opt = app.Create.NewGeometryOptions()
opt.ComputeReferences = 1
opt.IncludeNonVisibleObjects = 1
opt.View = doc.ActiveView


lines = UnwrapElement(IN[0])

edgeArray = []



for r in lines:
	geomElem = r.get_Geometry(opt)
	enum1 = geomElem.GetEnumerator() ; enum1.MoveNext()
	geo2 = enum1.Current
	edgeArray.append(geo2.Edges)
	

OUT = edgeArray
# ----------------------------------------

# group: reference
python_script_8 = Python(IN[0]=code_block_5)
# ---------- python_script_8.python (50 lines) ----------
import clr
clr.AddReference('RevitAPI')
from Autodesk.Revit.DB import *

clr.AddReference("RevitNodes")
import Revit
clr.ImportExtensions(Revit.Elements)
clr.ImportExtensions(Revit.GeometryConversion)

clr.AddReference("RevitServices")
import RevitServices
from RevitServices.Persistence import DocumentManager
from RevitServices.Transactions import TransactionManager

doc = DocumentManager.Instance.CurrentDBDocument
uiapp = DocumentManager.Instance.CurrentUIApplication
app = uiapp.Application

if isinstance(IN[0], list):
	lines = []
	for i in IN[0]:
		lines.append(UnwrapElement(i))
else:
	lines = [UnwrapElement(IN[0])]
	
opt = app.Create.NewGeometryOptions()
opt.ComputeReferences = 1
opt.IncludeNonVisibleObjects = 1
opt.View = doc.ActiveView


lines = UnwrapElement(IN[0])

edgeArray = []



for r in lines:
	geomElem = r.get_Geometry(opt)
	enum1 = geomElem.GetEnumerator() ; enum1.MoveNext()
	geo2 = enum1.Current
	edgeArray.append(geo2.Edges)

nodeRefs = []

for i in range(0,len(edgeArray)):
	for edge in edgeArray[i]:
		nodeRefs.append(edge.GetEndPointReference(0))

OUT = nodeRefs
# ----------------------------------------

# group: reference
python_script_9 = Python()  # unwired: IN[0], IN[1]
# ---------- python_script_9.python (66 lines) ----------
import clr
clr.AddReference('RevitAPI')
from Autodesk.Revit.DB import *

clr.AddReference("RevitNodes")
import Revit
clr.ImportExtensions(Revit.Elements)
clr.ImportExtensions(Revit.GeometryConversion)

clr.AddReference("RevitServices")
import RevitServices
from RevitServices.Persistence import DocumentManager
from RevitServices.Transactions import TransactionManager

doc = DocumentManager.Instance.CurrentDBDocument
uiapp = DocumentManager.Instance.CurrentUIApplication
app = uiapp.Application

if isinstance(IN[0], list):
	lines = []
	for i in IN[0]:
		lines.append(UnwrapElement(i))
else:
	lines = [UnwrapElement(IN[0])]

edgeCurves = [IN[1]]
	
	
opt = app.Create.NewGeometryOptions()
opt.ComputeReferences = 1
opt.IncludeNonVisibleObjects = 1
opt.View = doc.ActiveView


lines = UnwrapElement(IN[0])

edgeArray = []



for r in lines:
	geomElem = r.get_Geometry(opt)
	enum1 = geomElem.GetEnumerator() ; enum1.MoveNext()
	geo2 = enum1.Current
	edgeArray.append(geo2.Edges)

nodeRefs = []


TransactionManager.Instance.EnsureInTransaction(doc)


for i in range(0,len(edgeArray)):
	for edge,crvs in zip(edgeArray[i],edgeCurves[i]):
		ref = ReferenceArray()
		ref.Append(edge.GetEndPointReference(0))
		ref.Append(edge.GetEndPointReference(1))
		dim = doc.Create.NewDimension(doc.ActiveView, crvs, ref)



TransactionManager.Instance.TransactionTaskDone()



OUT = nodeRefs
# ----------------------------------------

# group: reference
python_script_10 = Python(IN[0]=code_block_5)
# ---------- python_script_10.python (45 lines) ----------
import clr
clr.AddReference('RevitAPI')
from Autodesk.Revit.DB import *

clr.AddReference("RevitNodes")
import Revit
clr.ImportExtensions(Revit.Elements)
clr.ImportExtensions(Revit.GeometryConversion)

clr.AddReference("RevitServices")
import RevitServices
from RevitServices.Persistence import DocumentManager
from RevitServices.Transactions import TransactionManager

doc = DocumentManager.Instance.CurrentDBDocument
uiapp = DocumentManager.Instance.CurrentUIApplication
app = uiapp.Application

if isinstance(IN[0], list):
	lines = []
	for i in IN[0]:
		lines.append(UnwrapElement(i))
else:
	lines = [UnwrapElement(IN[0])]
	
opt = app.Create.NewGeometryOptions()
opt.ComputeReferences = 1
opt.IncludeNonVisibleObjects = 1
opt.View = doc.ActiveView


lines = UnwrapElement(IN[0])

edgeArray = []



for r in lines:
	geomElem = r.get_Geometry(opt)
	enum1 = geomElem.GetEnumerator() ; enum1.MoveNext()
	geo2 = enum1.Current
	edgeArray.append(geo2.Edges)
	

OUT = edgeArray[0][5].AsCurve()
# ----------------------------------------

# group: reference
python_script_11 = Python(IN[0]=code_block_5)
# ---------- python_script_11.python (50 lines) ----------
import clr
clr.AddReference('RevitAPI')
from Autodesk.Revit.DB import *

clr.AddReference("RevitNodes")
import Revit
clr.ImportExtensions(Revit.Elements)
clr.ImportExtensions(Revit.GeometryConversion)

clr.AddReference("RevitServices")
import RevitServices
from RevitServices.Persistence import DocumentManager
from RevitServices.Transactions import TransactionManager

doc = DocumentManager.Instance.CurrentDBDocument
uiapp = DocumentManager.Instance.CurrentUIApplication
app = uiapp.Application

if isinstance(IN[0], list):
	lines = []
	for i in IN[0]:
		lines.append(UnwrapElement(i))
else:
	lines = [UnwrapElement(IN[0])]
	
opt = app.Create.NewGeometryOptions()
opt.ComputeReferences = 1
opt.IncludeNonVisibleObjects = 1
opt.View = doc.ActiveView


lines = UnwrapElement(IN[0])

faceArray = []

for r in lines:
	geomElem = r.get_Geometry(opt)
	enum1 = geomElem.GetEnumerator() ; enum1.MoveNext()
	geo2 = enum1.Current
	faceArray.append(geo2.Faces)

for face in faceArray:
	geomElem = fac.get_Geometry(opt)
	enum1 = geomElem.GetEnumerator() ; enum1.MoveNext()
	geo2 = enum1.Current
	faceArray.append(geo2.Faces)



OUT = faceArray
# ----------------------------------------

python_script_12 = Python(IN[0]=code_block_5)
# ---------- python_script_12.python (56 lines) ----------
import clr
clr.AddReference('RevitAPI')
from Autodesk.Revit.DB import *

clr.AddReference("RevitNodes")
import Revit
clr.ImportExtensions(Revit.Elements)
clr.ImportExtensions(Revit.GeometryConversion)

clr.AddReference("RevitServices")
import RevitServices
from RevitServices.Persistence import DocumentManager
from RevitServices.Transactions import TransactionManager

doc = DocumentManager.Instance.CurrentDBDocument
uiapp = DocumentManager.Instance.CurrentUIApplication
app = uiapp.Application

if isinstance(IN[0], list):
	lines = []
	for i in IN[0]:
		lines.append(UnwrapElement(i))
else:
	lines = [UnwrapElement(IN[0])]


	
opt = app.Create.NewGeometryOptions()
opt.ComputeReferences = 1
opt.IncludeNonVisibleObjects = 1
opt.View = doc.ActiveView


lines = UnwrapElement(IN[0])

faceArray = []
edgeArray = []
edgeCurve = []


for r in lines:
	geomElem = r.get_Geometry(opt)
	enum1 = geomElem.GetEnumerator() ; enum1.MoveNext()
	geo2 = enum1.Current
	faceArray = geo2.Faces

for face in faceArray:
	edgeArray.append(face.EdgeLoops)

for edge in edgeArray[0][0]:
	edgeCurve.append(edge.AsCurve().ToProtoType())




OUT = edgeArray[0][0],edgeCurve
# ----------------------------------------
code_block_6 = CodeBlock(a=python_script_12) { a[0]; }
code_block_7 = CodeBlock(a=python_script_12) { a[1]; }
code_block_8 = CodeBlock { -1000; }

# group: from Wombat
smartOffset_3 = WombatDynamo.Curve.SmartOffset(code_block_7, code_block_8)

python_script_13 = Python(IN[0]=smartOffset_3)
# ---------- python_script_13.python (28 lines) ----------
import clr
clr.AddReference('RevitAPI')
from Autodesk.Revit.DB import *

clr.AddReference("RevitNodes")
import Revit
clr.ImportExtensions(Revit.Elements)
clr.ImportExtensions(Revit.GeometryConversion)

clr.AddReference("RevitServices")
import RevitServices
from RevitServices.Persistence import DocumentManager
from RevitServices.Transactions import TransactionManager

doc = DocumentManager.Instance.CurrentDBDocument
uiapp = DocumentManager.Instance.CurrentUIApplication
app = uiapp.Application

lines = IN[0]

edges = []

for l in lines:
	edges.append(l.ToRevitType())



OUT = edges
# ----------------------------------------

# group: reference
python_script_14 = Python(IN[0]=code_block_6, IN[1]=python_script_13)
# ---------- python_script_14.python (43 lines) ----------
import clr
clr.AddReference('RevitAPI')
from Autodesk.Revit.DB import *

clr.AddReference("RevitNodes")
import Revit
clr.ImportExtensions(Revit.Elements)
clr.ImportExtensions(Revit.GeometryConversion)

clr.AddReference("RevitServices")
import RevitServices
from RevitServices.Persistence import DocumentManager
from RevitServices.Transactions import TransactionManager

doc = DocumentManager.Instance.CurrentDBDocument
uiapp = DocumentManager.Instance.CurrentUIApplication
app = uiapp.Application


edgeArray = [IN[0]]

edgeCurves = [IN[1]]
	

dimensions = []

TransactionManager.Instance.EnsureInTransaction(doc)


for i in range(0,len(edgeArray)):
	for edge,crvs in zip(edgeArray[i],edgeCurves[i]):
		ref = ReferenceArray()
		ref.Append(edge.GetEndPointReference(0))
		ref.Append(edge.GetEndPointReference(1))
		dim = doc.Create.NewDimension(doc.ActiveView, crvs, ref)
		dimensions.append(dim)


TransactionManager.Instance.TransactionTaskDone()



OUT = dim
# ----------------------------------------
