# Dynamo graph Automatic Dimension05.dyn (Dynamo 1.3.1.1736)

python_script = Python()  # unwired: IN[0]
# ---------- python_script.python (55 lines) ----------
import clr
clr.AddReference('RevitAPI')
from Autodesk.Revit.DB import *

clr.AddReference("RevitNodes")
import Revit
clr.ImportExtensions(Revit.Elements)
clr.ImportExtensions(Revit.GeometryConversion)

clr.AddReference("RevitServices")
import RevitServices
from RevitServices.Persistence import DocumentManager
from RevitServices.Transactions import TransactionManager

doc = DocumentManager.Instance.CurrentDBDocument

if isinstance(IN[0], list):
	lines = []
	for i in IN[0]:
		lines.append(UnwrapElement(i))
else:
	lines = [UnwrapElement(IN[0])]


crvs = []

for line in lines:
	crvs.append(line.GeometryCurve)
	

#grids = UnwrapElement(IN[1])

"""gridRef = ReferenceArray()
opt = Options()
opt.ComputeReferences = True
opt.IncludeNonVisibleObjects = True
opt.View = doc.ActiveView
for grid in grids:
	for obj in grid.get_Geometry(opt):
		if isinstance(obj, Line):
			gline = obj
			gridRef.Append(gline.Reference)"""

TransactionManager.Instance.EnsureInTransaction(doc)


for crv in crvs:
	ref = ReferenceArray()
	ref.Append(crv.GetEndPointReference(0))
	ref.Append(crv.GetEndPointReference(1))
	dim = doc.Create.NewDimension(doc.ActiveView, crv, ref)

TransactionManager.Instance.TransactionTaskDone()

OUT = dim
# ----------------------------------------

# group: DIM. GRIDLINES
select_model_elements = DSModelElementsSelection()  # 4 picked in the model

curve = Grid.Curve(select_model_elements)
python_script_2 = Python(IN[1]=select_model_elements)  # unwired: IN[0]
# ---------- python_script_2.python (38 lines) ----------
import clr
clr.AddReference('RevitAPI')
from Autodesk.Revit.DB import *

clr.AddReference("RevitNodes")
import Revit
clr.ImportExtensions(Revit.Elements)
clr.ImportExtensions(Revit.GeometryConversion)

clr.AddReference("RevitServices")
import RevitServices
from RevitServices.Persistence import DocumentManager
from RevitServices.Transactions import TransactionManager

doc = DocumentManager.Instance.CurrentDBDocument

line = IN[0].ToRevitType()
grids = UnwrapElement(IN[1])

gridRef = ReferenceArray()
opt = Options()
opt.ComputeReferences = True
opt.IncludeNonVisibleObjects = True
opt.View = doc.ActiveView

for grid in grids:
	for obj in grid.get_Geometry(opt):
		if isinstance(obj, Line):
			gline = obj
			gridRef.Append(gline.Reference)

TransactionManager.Instance.EnsureInTransaction(doc)

dim = doc.Create.NewDimension(doc.ActiveView, line, gridRef)

TransactionManager.Instance.TransactionTaskDone()

OUT = dim, gridRef
# ----------------------------------------

# group: DIM. LINES
select_model_elements_2 = DSModelElementsSelection()

# group: DIM. MULTIPLE LINES W/ OFFSET
select_model_elements_3 = DSModelElementsSelection()

curves = Element.Curves(select_model_elements_3)
code_block = CodeBlock { -1000; }

# group: from Wombat
smartOffset = WombatDynamo.Curve.SmartOffset(curves, code_block)

flatten = Flatten(smartOffset)
python_script_3 = Python(IN[0]=select_model_elements_3, IN[1]=flatten)
# ---------- python_script_3.python (52 lines) ----------
import clr
clr.AddReference('RevitAPI')
from Autodesk.Revit.DB import *

clr.AddReference("RevitNodes")
import Revit
clr.ImportExtensions(Revit.Elements)
clr.ImportExtensions(Revit.GeometryConversion)

clr.AddReference("RevitServices")
import RevitServices
from RevitServices.Persistence import DocumentManager
from RevitServices.Transactions import TransactionManager

doc = DocumentManager.Instance.CurrentDBDocument

if isinstance(IN[0], list):
	lines = []
	for i in IN[0]:
		lines.append(UnwrapElement(i))
else:
	lines = [UnwrapElement(IN[0])]


crvs = []

for line in lines:
	crvs.append(line.GeometryCurve)


if isinstance(IN[1], list):
	linea = []
	for i in IN[1]:
		linea.append(UnwrapElement(i).ToRevitType())
else:
	linea = [UnwrapElement(IN[1]).ToRevitType()]


TransactionManager.Instance.EnsureInTransaction(doc)


for i in range (0,len(linea)):
	ref = ReferenceArray()
	ref.Append(crvs[i].GetEndPointReference(0))
	ref.Append(crvs[i].GetEndPointReference(1))
	dim = doc.Create.NewDimension(doc.ActiveView, linea[i], ref)



TransactionManager.Instance.TransactionTaskDone()

OUT = linea
# ----------------------------------------

# group: DIM. SLABS
select_model_elements_4 = DSModelElementsSelection()

code_block_2 = CodeBlock(a=select_model_elements_4) { {a}; }
python_script_4 = Python(IN[0]=code_block_2)
# ---------- python_script_4.python (56 lines) ----------
import clr
clr.AddReference('RevitAPI')
from Autodesk.Revit.DB import *

clr.AddReference("RevitNodes")
import Revit
clr.ImportExtensions(Revit.Elements)
clr.ImportExtensions(Revit.GeometryConversion)

clr.AddReference("RevitServices")
import RevitServices
from RevitServices.Persistence import DocumentManager
from RevitServices.Transactions import TransactionManager

doc = DocumentManager.Instance.CurrentDBDocument
uiapp = DocumentManager.Instance.CurrentUIApplication
app = uiapp.Application

if isinstance(IN[0], list):
	lines = []
	for i in IN[0]:
		lines.append(UnwrapElement(i))
else:
	lines = [UnwrapElement(IN[0])]


	
opt = app.Create.NewGeometryOptions()
opt.ComputeReferences = 1
opt.IncludeNonVisibleObjects = 1
opt.View = doc.ActiveView


lines = UnwrapElement(IN[0])

faceArray = []
edgeArray = []
edgeCurve = []


for r in lines:
	geomElem = r.get_Geometry(opt)
	enum1 = geomElem.GetEnumerator() ; enum1.MoveNext()
	geo2 = enum1.Current
	faceArray = geo2.Faces

for face in faceArray:
	edgeArray.append(face.EdgeLoops)

for edge in edgeArray[0][0]:
	edgeCurve.append(edge.AsCurve().ToProtoType())




OUT = edgeArray[0][0],edgeCurve
# ----------------------------------------
code_block_3 = CodeBlock(a=python_script_4) { a[0]; }
code_block_4 = CodeBlock(a=python_script_4) { a[1]; }
code_block_5 = CodeBlock { -1000; }

# group: from Wombat
smartOffset_2 = WombatDynamo.Curve.SmartOffset(code_block_4, code_block_5)

python_script_5 = Python(IN[0]=smartOffset_2)
# ---------- python_script_5.python (28 lines) ----------
import clr
clr.AddReference('RevitAPI')
from Autodesk.Revit.DB import *

clr.AddReference("RevitNodes")
import Revit
clr.ImportExtensions(Revit.Elements)
clr.ImportExtensions(Revit.GeometryConversion)

clr.AddReference("RevitServices")
import RevitServices
from RevitServices.Persistence import DocumentManager
from RevitServices.Transactions import TransactionManager

doc = DocumentManager.Instance.CurrentDBDocument
uiapp = DocumentManager.Instance.CurrentUIApplication
app = uiapp.Application

lines = IN[0]

edges = []

for l in lines:
	edges.append(l.ToRevitType())



OUT = edges
# ----------------------------------------

# group: reference
python_script_6 = Python(IN[0]=code_block_3, IN[1]=python_script_5)
# ---------- python_script_6.python (43 lines) ----------
import clr
clr.AddReference('RevitAPI')
from Autodesk.Revit.DB import *

clr.AddReference("RevitNodes")
import Revit
clr.ImportExtensions(Revit.Elements)
clr.ImportExtensions(Revit.GeometryConversion)

clr.AddReference("RevitServices")
import RevitServices
from RevitServices.Persistence import DocumentManager
from RevitServices.Transactions import TransactionManager

doc = DocumentManager.Instance.CurrentDBDocument
uiapp = DocumentManager.Instance.CurrentUIApplication
app = uiapp.Application


edgeArray = [IN[0]]

edgeCurves = [IN[1]]
	

dimensions = []

TransactionManager.Instance.EnsureInTransaction(doc)


for i in range(0,len(edgeArray)):
	for edge,crvs in zip(edgeArray[i],edgeCurves[i]):
		ref = ReferenceArray()
		ref.Append(edge.GetEndPointReference(0))
		ref.Append(edge.GetEndPointReference(1))
		dim = doc.Create.NewDimension(doc.ActiveView, crvs, ref)
		dimensions.append(dim)


TransactionManager.Instance.TransactionTaskDone()



OUT = dim
# ----------------------------------------

python_script_7 = Python(IN[1]=select_model_elements)  # unwired: IN[0]
# ---------- python_script_7.python (38 lines) ----------
import clr
clr.AddReference('RevitAPI')
from Autodesk.Revit.DB import *

clr.AddReference("RevitNodes")
import Revit
clr.ImportExtensions(Revit.Elements)
clr.ImportExtensions(Revit.GeometryConversion)

clr.AddReference("RevitServices")
import RevitServices
from RevitServices.Persistence import DocumentManager
from RevitServices.Transactions import TransactionManager

doc = DocumentManager.Instance.CurrentDBDocument

line = IN[0].ToRevitType()
grids = UnwrapElement(IN[1])

gridRef = ReferenceArray()
opt = Options()
opt.ComputeReferences = True
opt.IncludeNonVisibleObjects = False
opt.View = doc.ActiveView

gridobj = []

for grid in grids:
	gridobj.append(grid.get_Geometry(opt))


TransactionManager.Instance.EnsureInTransaction(doc)

#dim = doc.Create.NewDimension(doc.ActiveView, line, gridRef)

TransactionManager.Instance.TransactionTaskDone()

OUT = gridRef,gridobj
# ----------------------------------------
location = StructuralFraming.Location(select_model_elements)
startPoint = Curve.StartPoint(location)
firstItem = List.FirstItem(startPoint)
lastItem = List.LastItem(startPoint)
byStartPointEndPoint = Line.ByStartPointEndPoint(startPoint=firstItem, endPoint=lastItem)
code_block_6 = CodeBlock { -500; }
offset = Curve.Offset(curve=byStartPointEndPoint, distance=code_block_6)
python_script_8 = Python(IN[0]=offset, IN[1]=select_model_elements)
# ---------- python_script_8.python (38 lines) ----------
import clr
clr.AddReference('RevitAPI')
from Autodesk.Revit.DB import *

clr.AddReference("RevitNodes")
import Revit
clr.ImportExtensions(Revit.Elements)
clr.ImportExtensions(Revit.GeometryConversion)

clr.AddReference("RevitServices")
import RevitServices
from RevitServices.Persistence import DocumentManager
from RevitServices.Transactions import TransactionManager

doc = DocumentManager.Instance.CurrentDBDocument

line = IN[0].ToRevitType()
grids = UnwrapElement(IN[1])

gridRef = ReferenceArray()
opt = Options()
opt.ComputeReferences = True
opt.IncludeNonVisibleObjects = False
opt.View = doc.ActiveView

for grid in grids:
	for obj in grid.get_Geometry(opt):
		if isinstance(obj, Line):
			gline = obj
			gridRef.Append(gline.Reference)

TransactionManager.Instance.EnsureInTransaction(doc)

dim = doc.Create.NewDimension(doc.ActiveView, line, gridRef)

TransactionManager.Instance.TransactionTaskDone()

OUT = dim, gridRef
# ----------------------------------------
