# Dynamo graph Automatic fire detection_v2.dyn (Dynamo 2.2.0.4667)

# group: DS to calculate the spacing
spacing_calc = CodeBlock()
# ---------- spacing_calc.designscript (50 lines) ----------
/*This is the definition which works out the detector spacing along a given line
Inputs:
l = Line length
s = Detector diameter

Outputs:
c[] = array of detector spacing*/


def Points(l,s){

a=[Imperative]{
	//this calculates the number of detectors needed along the line
	if(l%s==0){
		return=Math.Floor((l/s)-1);
	}
	else{
		return=Math.Floor(l/s);
	}
	}

c[a]=null;

[Imperative]{
	//this caculates where to put the detectors
	if(l<=s){
		c[]=[l/2];
//One detector in the center;
	}
	elseif(l>s&&l<=s+s/2){
		c[]=[l/3,(l*2)/3];
//Two detectors evenly spaced from either end;
	}
	elseif(l>s+s/2&&l<=2*s){
		c[]=[s/2,l-s/2];
//Two detectors half spacing distance from either end;
	}
	elseif(l>s*2){
		for(j in 1..a-1){
			c[j]=(j*((l-s)/(a))+(s/2));
//X no. detectors evenly spaced;
			}
		c[0]=s/2;
//and two detectors half spacing distance from either end;
		c[a]=l-s/2;
		}

	}
return = c[];
};
# ----------------------------------------

# group: Please only edit here! Select the detector type, spacing in X & Y directions (12000mm optical or 10000mm heat), area coverage (100m2 optical or 50m2 heat) and offset height.
family_types = FamilyTypes("fire place hang:fire place hang")  # graph input
detector_coverage_spacing = DoubleSlider(12000, range=500..12000 step 500)  # "Detector Coverage Spacing Longest Edge"; graph input
detector_coverage_spacing_2 = DoubleSlider(6000, range=6000..12000 step 1000)  # "Detector Coverage Spacing Perpendicular Edge"; graph input
detector_height = DoubleSlider(2400, range=0..5000 step 10)  # graph input
detector_coverage = DoubleSlider(100, range=50..100 step 50)  # graph input

boolean = BoolSelector(true)

# group: pick model elements
python_script = Python(IN[0]=boolean)
# ---------- python_script.python (33 lines) ----------
#Copyright(c) 2017, john pierson
# @60secondrevit, http://sixtysecondrevit.com
#Based on a node from Dimitar Venkov
#adapted by john pierson for rhythm
import clr

clr.AddReference("RevitAPIUI")
from  Autodesk.Revit.UI import *

clr.AddReference("RevitServices")
import RevitServices
from RevitServices.Persistence import DocumentManager
doc = DocumentManager.Instance.CurrentDBDocument
uidoc=DocumentManager.Instance.CurrentUIApplication.ActiveUIDocument

clr.AddReference("RevitNodes")
import Revit
clr.ImportExtensions(Revit.Elements)

sel1 = uidoc.Selection
ot1 = Selection.ObjectType.Element
el_ref = sel1.PickObjects(ot1, "Select model elements")
typelist = list()
idlist = list()
for i in el_ref:
	
	try:
		typelist.append(doc.GetElement(i.ElementId))
	except:
		typelist.append(list())
		

OUT = typelist
# ----------------------------------------
pick_model_elements = Custom[Pick Model Elements]()

# group: room boundaries
python_script_2 = Python(IN[0]=python_script)
# ---------- python_script_2.python (46 lines) ----------
import clr
clr.AddReference('RevitAPI')
from Autodesk.Revit.DB import *
import Autodesk

clr.AddReference("RevitNodes")
import Revit
clr.ImportExtensions(Revit.GeometryConversion)

items = UnwrapElement(IN[0])
version = 2018
elementlist = list()
curvelist = list()

for item in items:
	doc = item.Document
	calculator = SpatialElementGeometryCalculator(doc)
	options = Autodesk.Revit.DB.SpatialElementBoundaryOptions()
	# get boundary location from area computation settings
	boundloc = Autodesk.Revit.DB.AreaVolumeSettings.GetAreaVolumeSettings(doc).GetSpatialElementBoundaryLocation(SpatialElementType.Room)
	options.SpatialElementBoundaryLocation = boundloc
	#method #1 - get boundary segments
	blist = list()
	clist = list()
	try:
		for boundarylist in item.GetBoundarySegments(options):
			for boundary in boundarylist:
				blist.append(doc.GetElement(boundary.ElementId))
				if version > 2016:
					clist.append(boundary.GetCurve().ToProtoType())
				else:
					clist.append(boundary.Curve.ToProtoType())
	except:
		pass
	#method #2 - spatial element geometry calculator
	"""try:
		results = calculator.CalculateSpatialElementGeometry(item)
		for face in results.GetGeometry().Faces:
			for bface in results.GetBoundaryFaceInfo(face):
				blist.append(doc.GetElement(bface.SpatialBoundaryElement.HostElementId))
	except:
		pass	"""
	# write results to list
	elementlist.append(blist)
	curvelist.append(clist)
OUT = (elementlist,curvelist)
# ----------------------------------------
boundaries = Custom[Room.Boundaries](room=python_script)

code_block = CodeBlock(a=python_script_2) { a[1]; }
code_block_2 = CodeBlock { 1; }

# group: DesignScript to create a line perpendicular to the initial spacing calculation then place detectors
perpendicular_spacing = CodeBlock()  # "Perpendicular Spacing Calculation"; unwired: family_type, a, s, space_area, bound, vec, point, count_sum, space
# ---------- perpendicular_spacing.designscript (92 lines) ----------
/*This block takes the points calculated with the previous nodes.
Using the normal of each point, projects the point to the opposite boundary wall.
It then creates a line between the two points
and re-runs the spacing calc to find out where to put the detectors.

Inputs:
point = The inital points calculated using the spacing calc
bound = the space boundaries
vec = reversed vector of the point normal
count_sum = an array listing how many inital points are in a space
s = the spacing of each detector
family_type = the type of family to place into revit

Output:
None - this places the family instance in revit

*/

//Below takes in each input
family = family_type;
cover_area = a;
spacing = s;
area[] = space_area;
boundary[] = bound[];
vector[]=vec[];
points[] = point[];
sub_num[] = count_sum[];
spaces[] = space[];

//Below sets up each array
familyinstance[] = null;
perp_lines[][] = null;
clean_perp_lines[][] = null;
final_lines[][] = null;


perp_points[][] = null;
clean_perp_points[][] = null;
line_lengths = null;
points_total[][] = null;
check[] = null;
error[] = null;

[Imperative]{
	for(i in 0..Count(sub_num)){
		for(j in 0..sub_num[i]-1){//This loop projects the points to the opposite boundary

			perp_points[i][j] = points[i][j].Project(boundary[i], vector[i][j]);
		}
	}
}

clean_perp_points[] = List.Clean(perp_points[],false);
//removes nulls and empty lists;
[Imperative]{
	for(i in 0..Count(sub_num)){
		for(j in 0..sub_num[i]-1){//this loop draws a line between each of the above points

			perp_lines[i][j] = Line.ByStartPointEndPoint(clean_perp_points[i][j][0][0],clean_perp_points[i][j][1][0]);
		}
	}


	for(i in 0..Count(sub_num)){
		for(j in 0..sub_num[i]-1){
			//this calculates the line length;
			line_lengths[i][j] = perp_lines[i][j].Length;

			//passes the length and spacing to the spacing calc;
			points_segment[i][j] = Points(line_lengths[i][j],s);

			//Flattens the points list per space
			points_total[i][j] = perp_lines[i][j].PointAtSegmentLength(points_segment[i][j]);
			check[i] = Count(Flatten(points_total[i]));
		}

	}
	//Error checks the space size Vs number of detectors.
	//if there are insufficient dectors for the m2 area of space and error will be output
	for(i in 0..Count(check)-1){
		if(check[i]>(area[i]/cover_area)){
			familyinstance[i] = points_total[i];
		}
		else{
			error[i] = "Please verify shape of space and detector distribution in space: " +spaces[i].Name + ". Current spacing gives "+check[i] +" detectors. Minumum number required is: "+Math.Ceiling(area[i]/cover_area);
		}
	}

};
//final_family[] = FamilyInstance.ByPoint(family,List.Clean(familyinstance,false));
error;
List.Clean(familyinstance);
# ----------------------------------------

# group: element area
python_script_3 = Python(IN[0]=python_script)
# ---------- python_script_3.python (12 lines) ----------
import clr
clr.AddReference('RevitAPI')
from Autodesk.Revit.DB import *

faminsts = UnwrapElement(IN[0])
elementlist = list()
for item in faminsts:
	try:
		elementlist.append(item.Area)
	except:
		elementlist.append(None)
OUT = elementlist
# ----------------------------------------
area = Custom[Element.Area]()  # unwired: element

# group: Converts the selected elements to room boundaries & areas and collects the space IDs
boolean_2 = BoolSelector(false)  # graph input
clean = List.Clean(list=code_block, preserveIndices=boolean_2)
isEmpty = List.IsEmpty(list=code_block, lacing=Longest)
filterByBoolMask = List.FilterByBoolMask(list=python_script, mask=isEmpty)
clean_2 = List.Clean(list=python_script_3, preserveIndices=boolean_2)

# group: Keep lines only
type = Object.Type(obj=clean)
code_block_3 = CodeBlock { "Line"; }
contains = String.Contains(str=type, searchFor=code_block_3)
filterByBoolMask_2 = List.FilterByBoolMask(list=clean, mask=contains)

direction = Line.Direction(line=filterByBoolMask_2.in)

# group: Finds the longest boundary wall to start the first calculation
length = Vector.Length(vector=direction)
maximumItem = List.MaximumItem(list=length)

indexOf = List.IndexOf(list=length, element=maximumItem)
getItemAtIndex = List.GetItemAtIndex(list=filterByBoolMask_2.in, index=indexOf, lacing=Shortest)

# group: Inital spacing calc along the longest edge
curve_length_of_longest_edge = Curve.Length(curve=getItemAtIndex)

floor = Math.Floor(number=curve_length_of_longest_edge)
python_script_4 = Python(IN[0]=floor, IN[1]=detector_coverage_spacing)
# ---------- python_script_4.python (35 lines) ----------
import clr
import math

lengths = IN[0]
diameter = IN[1]

def DetectorsNumber(l,s):
	a = 0
	l = int(l)
	if (l%s==0):
		a = math.floor((l/s)-1)
	else:
		a = math.floor(l/s)
		
	a = int(a)
	c = []
	
	if(l<=s):
		c.append(l/2) #One detector in the center;
	elif (l>s and l<=s+s/2): #Two detectors evenly spaced from either end;
		c.append([l/3,(l*2)/3])
	elif(l>s+s/2 and l<=2*s): #Two detectors half spacing distance from either end
		c.append([s/2,l-s/2])
	elif(l>s*2):
		temp = []
		temp.Add(s/2)
		for j in range (1,a-1):
			temp.Add(j*((l-s)/(a))+(s/2))
		temp.Add(l-s/2)
		c.append(temp)
	return c


		
OUT = [DetectorsNumber(l,diameter)[0] for l in lengths]
# ----------------------------------------

# group (continued): Inital spacing calc along the longest edge
places_calc_d_points_on_the = Curve.PointAtSegmentLength(curve=getItemAtIndex, segmentLength=python_script_4)  # "Places Calc'd points on the Curve"

# group: Finds the normal at each point and reverses the vector direction
normalAtParameter = Curve.NormalAtParameter(curve=getItemAtIndex, param=python_script_4)
reverse = Vector.Reverse(vector=normalAtParameter)

takeItems = List.TakeItems(list=reverse, amount=code_block_2, lacing=Longest)
python_script_5 = Python(IN[0]=places_calc_d_points_on_the, IN[1]=takeItems, IN[2]=clean)
# ---------- python_script_5.python (40 lines) ----------
import clr
clr.AddReference('ProtoGeometry')
from Autodesk.DesignScript.Geometry import *




def returnList(item):
	if isinstance(item, list):
		return item
	else:
		return [item]
	
pts = [returnList(p) for p in IN[0]]
direction = IN[1]
boundary = IN[2]

perpPoints = []
lines = []

def ProjectPoint(point, boundaries, direction):
	perpPts = []
	for i in range(0, len(boundaries)):
		a = point.Project(boundaries[i], direction)
		if a:
			perpPts.append(a)
	return perpPts
	#return Line.ByStartPointEndPoint(perpPts[0], perpPts[1])
	

for i in range(0, len(pts)):
	for j in range(0, len(pts[i])):
		perp = ProjectPoint(pts[i][j], boundary[i], direction[i][0])
		#perpPoints.append(perp[0][0])
		#perpPoints.append(perp[1][0])
		lines.append(Line.ByStartPointEndPoint(perp[0][0], perp[1][0]))



OUT = lines
# ----------------------------------------
curve_length_of_longest_edge_2 = Curve.Length(curve=python_script_5)
floor_2 = Math.Floor(number=curve_length_of_longest_edge_2)
python_script_6 = Python(IN[0]=floor_2, IN[1]=detector_coverage_spacing_2)  # same code as python_script_4
places_calc_d_points_on_the_2 = Curve.PointAtSegmentLength(curve=python_script_5, segmentLength=python_script_6)  # "Places Calc'd points on the Curve"
byPoint = FamilyInstance.ByPoint(familyType=family_types, point=places_calc_d_points_on_the_2)

# group: Change the detector height
code_block_4 = CodeBlock { "Dimensions_Height_Mounting"; }
setParameterByName = Element.SetParameterByName(element=byPoint, parameterName=code_block_4, value=detector_height)

# group: See here for Outputs
detectors_sucesfully_placed = Watch(setParameterByName)
errors = Watch(perpendicular_spacing.out21)

code_block_5 = CodeBlock { CalcPoints(3000,200); }
code_block_6 = CodeBlock { [5000,2000]; }
code_block_7 = CodeBlock { 600; }

# group: IN[0] = line length IN[1] = Detector diameter
python_script_7 = Python(IN[0]=code_block_6, IN[1]=code_block_7)
# ---------- python_script_7.python (32 lines) ----------
import clr
import math

lengths = IN[0]
s = IN[1]

def DetectorsNumber(l,s):
	a = 0
	if (l%s==0):
		a = math.floor((l/s)-1)
	else:
		a = math.floor(l/s)
		
	a = int(a)
	c = []
	
	if(l<=s):
		c.append(l/2) #One detector in the center;
	elif (l>s and l<=s+s/2): #Two detectors evenly spaced from either end;
		c.append(l/3,(l*2)/3)
	elif(l>s+s/2 and l<=2*s): #Two detectors half spacing distance from either end
		c.append([s/2,l-s/2])
	elif(l>s*2):
		c.append(s/2)
		for j in range (1,a-1):
			c.append(j*((l-s)/(a))+(s/2))
		c.append(l-s/2)	
	return c


		
OUT = [DetectorsNumber(l,s) for l in lengths]
# ----------------------------------------

code_block_8 = CodeBlock()
# ---------- code_block_8.designscript (16 lines) ----------
def CalcPoints(l,s){

[Imperative]{
	//this calculates the number of detectors needed along the line
a = 0;
		if(l%s==0){
			a = Math.Floor((l/s)-1);
		}
		else{
			a = Math.Floor(l/s);
		}

return a;
		}//close imperative

};
# ----------------------------------------
code_block_9 = CodeBlock(pt=places_calc_d_points_on_the_2) { CoordinateSystem.ByOrigin(pt.X,pt.Y, pt.Z); }
byWidthLength = Rectangle.ByWidthLength(cs=code_block_9, width=detector_coverage_spacing_2, length=detector_coverage_spacing)
