# Dynamo graph Automatic fire detection_v3.dyn (Dynamo 2.2.0.4667)

# group: Please only edit here! Select the detector type, spacing in X & Y directions (12000mm optical or 10000mm heat), area coverage (100m2 optical or 50m2 heat) and offset height.
family_types = FamilyTypes("Miele Washing Machine W 5820 WPS:Miele Washing Machine W 5820 WPS")  # graph input
detector_coverage_spacing = DoubleSlider(2500, range=500..12000 step 500)  # "Detector Coverage Spacing Longest Edge"; graph input
detector_coverage_spacing_2 = DoubleSlider(8000, range=6000..12000 step 1000)  # "Detector Coverage Spacing Perpendicular Edge"; graph input
detector_height = DoubleSlider(2400, range=0..5000 step 10)  # graph input
detector_coverage = DoubleSlider(100, range=50..100 step 50)  # graph input

boolean = BoolSelector(true)

# group: pick model elements
python_script = Python(IN[0]=boolean)
# ---------- python_script.python (33 lines) ----------
#Copyright(c) 2017, john pierson
# @60secondrevit, http://sixtysecondrevit.com
#Based on a node from Dimitar Venkov
#adapted by john pierson for rhythm
import clr

clr.AddReference("RevitAPIUI")
from  Autodesk.Revit.UI import *

clr.AddReference("RevitServices")
import RevitServices
from RevitServices.Persistence import DocumentManager
doc = DocumentManager.Instance.CurrentDBDocument
uidoc=DocumentManager.Instance.CurrentUIApplication.ActiveUIDocument

clr.AddReference("RevitNodes")
import Revit
clr.ImportExtensions(Revit.Elements)

sel1 = uidoc.Selection
ot1 = Selection.ObjectType.Element
el_ref = sel1.PickObjects(ot1, "Select model elements")
typelist = list()
idlist = list()
for i in el_ref:
	
	try:
		typelist.append(doc.GetElement(i.ElementId))
	except:
		typelist.append(list())
		

OUT = typelist
# ----------------------------------------

# group: room boundaries
python_script_2 = Python(IN[0]=python_script)
# ---------- python_script_2.python (46 lines) ----------
import clr
clr.AddReference('RevitAPI')
from Autodesk.Revit.DB import *
import Autodesk

clr.AddReference("RevitNodes")
import Revit
clr.ImportExtensions(Revit.GeometryConversion)

items = UnwrapElement(IN[0])
version = 2018
elementlist = list()
curvelist = list()

for item in items:
	doc = item.Document
	calculator = SpatialElementGeometryCalculator(doc)
	options = Autodesk.Revit.DB.SpatialElementBoundaryOptions()
	# get boundary location from area computation settings
	boundloc = Autodesk.Revit.DB.AreaVolumeSettings.GetAreaVolumeSettings(doc).GetSpatialElementBoundaryLocation(SpatialElementType.Room)
	options.SpatialElementBoundaryLocation = boundloc
	#method #1 - get boundary segments
	blist = list()
	clist = list()
	try:
		for boundarylist in item.GetBoundarySegments(options):
			for boundary in boundarylist:
				blist.append(doc.GetElement(boundary.ElementId))
				if version > 2016:
					clist.append(boundary.GetCurve().ToProtoType())
				else:
					clist.append(boundary.Curve.ToProtoType())
	except:
		pass
	#method #2 - spatial element geometry calculator
	"""try:
		results = calculator.CalculateSpatialElementGeometry(item)
		for face in results.GetGeometry().Faces:
			for bface in results.GetBoundaryFaceInfo(face):
				blist.append(doc.GetElement(bface.SpatialBoundaryElement.HostElementId))
	except:
		pass	"""
	# write results to list
	elementlist.append(blist)
	curvelist.append(clist)
OUT = (elementlist,curvelist)
# ----------------------------------------

code_block = CodeBlock(a=python_script_2) { a[1]; }
code_block_2 = CodeBlock { 1; }

# group: element area [m2]
python_script_3 = Python(IN[0]=python_script)
# ---------- python_script_3.python (22 lines) ----------
import clr
clr.AddReference('RevitAPI')
from Autodesk.Revit.DB import *

# Import DocumentManager
clr.AddReference("RevitServices")
import RevitServices
from RevitServices.Persistence import DocumentManager
doc = DocumentManager.Instance.CurrentDBDocument

getDocUnits = doc.GetUnits()
getDisplayUnits = getDocUnits.GetFormatOptions(UnitType.UT_Area).DisplayUnits


faminsts = UnwrapElement(IN[0])
elementlist = list()
for item in faminsts:
	try:
		elementlist.append(UnitUtils.ConvertFromInternalUnits(item.Area, getDisplayUnits))
	except:
		elementlist.append(None)
OUT = elementlist
# ----------------------------------------

# group: Converts the selected elements to room boundaries & areas and collects the space IDs
boolean_2 = BoolSelector(false)  # graph input
clean = List.Clean(list=code_block, preserveIndices=boolean_2)
clean_2 = List.Clean(list=python_script_3, preserveIndices=boolean_2)

# group: Keep lines only
type = Object.Type(obj=clean)
code_block_3 = CodeBlock { "Line"; }
contains = String.Contains(str=type, searchFor=code_block_3)
filterByBoolMask = List.FilterByBoolMask(list=clean, mask=contains)

direction = Line.Direction(line=filterByBoolMask.in)

# group: Finds the longest boundary wall to start the first calculation
length = Vector.Length(vector=direction)
maximumItem = List.MaximumItem(list=length)

indexOf = List.IndexOf(list=length, element=maximumItem)
getItemAtIndex = List.GetItemAtIndex(list=filterByBoolMask.in, index=indexOf, lacing=Shortest)

# group: Inital spacing calc along the longest edge
curve_length_of_longest_edge = Curve.Length(curve=getItemAtIndex)

floor = Math.Floor(number=curve_length_of_longest_edge)
python_script_4 = Python(IN[0]=floor, IN[1]=detector_coverage_spacing)
# ---------- python_script_4.python (35 lines) ----------
import clr
import math

lengths = IN[0]
diameter = IN[1]

def DetectorsNumber(l,s):
	a = 0
	l = int(l)
	if (l%s==0):
		a = math.floor((l/s)-1)
	else:
		a = math.floor(l/s)
		
	a = int(a)
	c = []
	
	if(l<=s):
		c.append(l/2) #One detector in the center;
	elif (l>s and l<=s+s/2): #Two detectors evenly spaced from either end;
		c.append([l/3,(l*2)/3])
	elif(l>s+s/2 and l<=2*s): #Two detectors half spacing distance from either end
		c.append([s/2,l-s/2])
	elif(l>s*2):
		temp = []
		temp.Add(s/2)
		for j in range (1,a):
			temp.Add(j*((l-s)/(a))+(s/2))
		temp.Add(l-s/2)
		c.append(temp)
	return c


		
OUT = [DetectorsNumber(l,diameter)[0] for l in lengths]
# ----------------------------------------

# group (continued): Inital spacing calc along the longest edge
places_calc_d_points_on_the = Curve.PointAtSegmentLength(curve=getItemAtIndex, segmentLength=python_script_4)  # "Places Calc'd points on the Curve"

# group: Finds the normal at each point and reverses the vector direction
normalAtParameter = Curve.NormalAtParameter(curve=getItemAtIndex, param=python_script_4)
reverse = Vector.Reverse(vector=normalAtParameter)

takeItems = List.TakeItems(list=reverse, amount=code_block_2, lacing=Longest)
python_script_5 = Python(IN[0]=places_calc_d_points_on_the, IN[1]=takeItems, IN[2]=clean)
# ---------- python_script_5.python (42 lines) ----------
import clr
clr.AddReference('ProtoGeometry')
from Autodesk.DesignScript.Geometry import *




def returnList(item):
	if isinstance(item, list):
		return item
	else:
		return [item]
	
pts = [returnList(p) for p in IN[0]]
direction = IN[1]
boundary = IN[2]

perpPoints = []
lines = []

def ProjectPoint(point, boundaries, direction):
	perpPts = []
	for i in range(0, len(boundaries)):
		a = point.Project(boundaries[i], direction)
		if a:
			perpPts.append(a)
	return perpPts
	#return Line.ByStartPointEndPoint(perpPts[0], perpPts[1])
	

for i in range(0, len(pts)):
	subList = []
	for j in range(0, len(pts[i])):
		perp = ProjectPoint(pts[i][j], boundary[i], direction[i][0])
		#perpPoints.append(perp[0][0])
		#perpPoints.append(perp[1][0])
		subList.append(Line.ByStartPointEndPoint(perp[0][0], perp[1][0]))
	lines.append(subList)



OUT = lines
# ----------------------------------------
curve_length_of_longest_edge_2 = Curve.Length(curve=python_script_5)
floor_2 = Math.Floor(number=curve_length_of_longest_edge_2)
python_script_6 = Python(IN[0]=floor_2, IN[1]=detector_coverage_spacing_2)
# ---------- python_script_6.python (40 lines) ----------
import clr
import math

lengths = IN[0]
diameter = IN[1]

def DetectorsNumber(l,s):
	a = 0
	l = int(l)
	if (l%s==0):
		a = math.floor((l/s)-1)
	else:
		a = math.floor(l/s)
		
	a = int(a)
	c = []
	
	if(l<=s):
		c.append(l/2) #One detector in the center;
	elif (l>s and l<=s+s/2): #Two detectors evenly spaced from either end;
		c.append([l/3,(l*2)/3])
	elif(l>s+s/2 and l<=2*s): #Two detectors half spacing distance from either end
		c.append([s/2,l-s/2])
	elif(l>s*2):
		temp = []
		temp.Add(s/2)
		for j in range (1,a):
			temp.Add(j*((l-s)/(a))+(s/2))
		temp.Add(l-s/2)
		c.append(temp)
	return c

result = []
for i in range(0, len(lengths)):
	subList = []
	for j in range(0, len(lengths[i])):
		subList.Add(DetectorsNumber(lengths[i][j], diameter)[0])
	result.append(subList)
		
OUT = result
# ----------------------------------------
places_calc_d_points_on_the_2 = Curve.PointAtSegmentLength(curve=python_script_5, segmentLength=python_script_6)  # "Places Calc'd points on the Curve"
byPoint = FamilyInstance.ByPoint(familyType=family_types, point=places_calc_d_points_on_the_2)

# group: Change the detector height
code_block_4 = CodeBlock { "Dimensions_Height_Mounting"; }
setParameterByName = Element.SetParameterByName(element=byPoint, parameterName=code_block_4, value=detector_height)

count = List.Count(list=byPoint@L2, lacing=Longest)
python_script_7 = Python(IN[0]=python_script, IN[1]=count, IN[2]=detector_coverage)
# ---------- python_script_7.python (46 lines) ----------
import clr

import math

clr.AddReference('RevitAPI')
from Autodesk.Revit.DB import *
from Autodesk.Revit.DB.Structure import *

clr.AddReference('RevitAPIUI')
from Autodesk.Revit.UI import *

clr.AddReference('System')
from System.Collections.Generic import List

clr.AddReference('RevitNodes')
import Revit
clr.ImportExtensions(Revit.GeometryConversion)
clr.ImportExtensions(Revit.Elements)

clr.AddReference('RevitServices')
import RevitServices
from RevitServices.Persistence import DocumentManager
from RevitServices.Transactions import TransactionManager

doc = DocumentManager.Instance.CurrentDBDocument



def AreaToMetric(value):
	getDocUnits = doc.GetUnits()
	getDisplayUnits = getDocUnits.GetFormatOptions(UnitType.UT_Area).DisplayUnits
	return UnitUtils.ConvertFromInternalUnits(value, getDisplayUnits)
	
rooms = UnwrapElement(IN[0])
detectors = IN[1]
coverageArea = IN[2]

result = []

for room, detector in zip(rooms, detectors):
	if AreaToMetric(room.Area)<coverageArea*detector:
		result.append(str(detector) + " detector(s) placed in Room " + room.Number)
	else:
		result.append(["Error in room " + str(room.Number) + ". Current spacing gives " + str(detector) +" detector(s). Minumum number required is: "+ str(int(math.ceil(AreaToMetric(room.Area)/coverageArea))), room])

OUT = result
# ----------------------------------------
