# Dynamo graph Basement Clearance 3 works for single element rev 2.dyn (Dynamo 2.0.1.4955)

# group: Select Upper Level Element
select_model_element = DSModelElementSelection()  # 1 picked in the model; graph input

boundingBox = Element.BoundingBox(element=select_model_element)
minPoint = BoundingBox.MinPoint(boundingBox=boundingBox)

# group: Select Lower Level Element
select_model_element_2 = DSModelElementSelection()  # 1 picked in the model; graph input

boundingBox_2 = Element.BoundingBox(element=select_model_element_2)
maxPoint = BoundingBox.MaxPoint(boundingBox=boundingBox_2)
byStartPointEndPoint = Line.ByStartPointEndPoint(startPoint=minPoint, endPoint=maxPoint)
Z = Point.Z(point=minPoint)
Z_2 = Point.Z(point=maxPoint)

# group: Allowable clearance
number_slider = DoubleSlider(2200, range=0..4000 step 0.1)  # graph input

# group: Check Clearance versus Allowable
sub = Z - Z_2
lt = sub < number_slider
filterByBoolMask = List.FilterByBoolMask(list=byStartPointEndPoint, mask=lt)

# group: Colour the model lines
code_block = CodeBlock()
# ---------- code_block.designscript (5 lines) ----------
//green
a=0;
r=0;
g=255;
b=0;
# ----------------------------------------
byARGB = Color.ByARGB(a=code_block.a, r=code_block.r, g=code_block.g, b=code_block.b)
overrideColorInView = Element.OverrideColorInView(element=filterByBoolMask.in, color=byARGB)
code_block_2 = CodeBlock()
# ---------- code_block_2.designscript (5 lines) ----------
//red
a=0;
r=255;
g=0;
b=0;
# ----------------------------------------
byARGB_2 = Color.ByARGB(a=code_block_2.a, r=code_block_2.r, g=code_block_2.g, b=code_block_2.b)

byCurve = ModelCurve.ByCurve(curve=filterByBoolMask.out)
overrideColorInView_2 = Element.OverrideColorInView(element=byCurve, color=byARGB_2)
