# Dynamo graph Basement Clearance 3 works for single element.dyn (Dynamo 2.0.1.4955)

# group: Draws model lines between points
byStartPointEndPoint = Line.ByStartPointEndPoint()  # unwired: startPoint, endPoint
byCurve = ModelCurve.ByCurve(curve=byStartPointEndPoint)

# group: Finds length between surfaces
byTwoPoints = Vector.ByTwoPoints()  # unwired: start, end
length = Vector.Length(vector=byTwoPoints)

# group: Allowable clearance
number_slider = DoubleSlider(2200, range=0..4000 step 0.1)  # graph input

# group: Checks clearance vs. allowable
lt = length < number_slider
filterByBoolMask = List.FilterByBoolMask(list=byCurve, mask=lt)

# group: Colour the model lines
code_block = CodeBlock()
# ---------- code_block.designscript (5 lines) ----------
//red
a=0;
r=255;
g=0;
b=0;
# ----------------------------------------
byARGB = Color.ByARGB(a=code_block.a, r=code_block.r, g=code_block.g, b=code_block.b)
overrideColorInView = Element.OverrideColorInView(element=filterByBoolMask.in, color=byARGB)
code_block_2 = CodeBlock()
# ---------- code_block_2.designscript (5 lines) ----------
//green
a=0;
r=0;
g=255;
b=0;
# ----------------------------------------
byARGB_2 = Color.ByARGB(a=code_block_2.a, r=code_block_2.r, g=code_block_2.g, b=code_block_2.b)
overrideColorInView_2 = Element.OverrideColorInView(element=filterByBoolMask.out, color=byARGB_2)

# group: Upper level elements
select_model_element = DSModelElementSelection()  # 1 picked in the model; graph input

# group: Finds bottom surface of the upper level elements
faces = Element.Faces(element=select_model_element)
code_block_3 = CodeBlock { 0.5; }
normalAtParameter = Surface.NormalAtParameter(surface=faces, u=code_block_3, v=code_block_3)
Z = Vector.Z(vector=normalAtParameter)
code_block_4 = CodeBlock { -0.5; }
lt_2 = Z < code_block_4
filterByBoolMask_2 = List.FilterByBoolMask(list=faces, mask=lt_2)

pointAtParameter = Surface.PointAtParameter(surface=filterByBoolMask_2.in, u=code_block_3, v=code_block_3)
filterByBoolMask_3 = List.FilterByBoolMask(list=normalAtParameter, mask=lt_2)
byOriginNormal = Plane.ByOriginNormal(origin=pointAtParameter, normal=filterByBoolMask_3.in)

# group: Grid of points - X start/end in m
code_block_5 = CodeBlock { -20; 20; }

# group: Divisions in m
code_block_6 = CodeBlock { 1; }

code_block_7 = CodeBlock(start_X=code_block_5.out0, end_X=code_block_5.out1, step=code_block_6) { start_X*1000..end_X*1000..step*1000; }

# group: Grid of points - Y start/end in m
code_block_8 = CodeBlock { -20; 20; }

code_block_9 = CodeBlock(start_Y=code_block_8.out0, end_Y=code_block_8.out1, step=code_block_6) { start_Y*1000..end_Y*1000..step*1000; }

# group: Lower level
levels = Levels(index=0)  # graph input

# group: Offset in mm
code_block_10 = CodeBlock { offset = 1000; }

# group: Apply offset
elevation = Level.Elevation(level=levels)
code_block_11 = CodeBlock(lower_level=elevation, offset=code_block_10) { lower_level - offset; }

# group: Points just below lower level
byCoordinates = Point.ByCoordinates(x=code_block_7, y=code_block_9, z=code_block_11, lacing=CrossProduct)

# group: Upper level
levels_2 = Levels(index=1)  # graph input

# group: Apply offset
elevation_2 = Level.Elevation(level=levels_2)
code_block_12 = CodeBlock(upper_level=elevation_2, offset=code_block_10) { upper_level + offset; }

# group: Points just above upper level
byCoordinates_2 = Point.ByCoordinates(x=code_block_7, y=code_block_9, z=code_block_12, lacing=CrossProduct)

byStartPointEndPoint_2 = Line.ByStartPointEndPoint(startPoint=byCoordinates, endPoint=byCoordinates_2)

# group: Finds intersection points (upper surface)
flatten = List.Flatten(list=byStartPointEndPoint_2)

intersect = Geometry.Intersect(geometry=byOriginNormal, other=flatten)

# group: Lower level elements
select_model_element_2 = DSModelElementSelection()  # 1 picked in the model; graph input

# group: Finds top surface of the lower level elements
faces_2 = Element.Faces(element=select_model_element_2)
code_block_13 = CodeBlock { 0.5; }
normalAtParameter_2 = Surface.NormalAtParameter(surface=faces_2, u=code_block_13, v=code_block_13)
Z_2 = Vector.Z(vector=normalAtParameter_2)
code_block_14 = CodeBlock { 0.5; }
gt = Z_2 > code_block_14
filterByBoolMask_4 = List.FilterByBoolMask(list=faces_2, mask=gt)

code_block_15 = CodeBlock { 0.5; }
pointAtParameter_2 = Surface.PointAtParameter(surface=filterByBoolMask_4.in, u=code_block_15, v=code_block_15)
filterByBoolMask_5 = List.FilterByBoolMask(list=normalAtParameter_2, mask=gt)
byOriginNormal_2 = Plane.ByOriginNormal(origin=pointAtParameter_2, normal=filterByBoolMask_5.in)

# group: Finds intersection points (lowersurface)
flatten_2 = List.Flatten(list=byStartPointEndPoint_2)

intersect_2 = Geometry.Intersect(geometry=byOriginNormal_2, other=flatten_2)
