# Dynamo graph BeamCentreline02.dyn (Dynamo 1.3.2.2480)

select_model_element = DSModelElementSelection()  # 1 picked in the model
faces = Element.Faces()  # unwired: arg0
area = Surface.Area(faces)
code_block = CodeBlock { 0..1; }
getItemAtIndex = List.GetItemAtIndex(list=faces, index=code_block)
deconstructSurface = Geometry.Surfaces.DeconstructSurface(faces)
center = Polygon.Center()  # unwired: arg0
boundingBox = Geometry.BoundingBox()  # unwired: arg0
properties = Custom[BoundingBox.Properties](boundingBox=boundingBox)  # Retrieves the centroid, width, depth and height of a given bounding box
select_model_elements = DSModelElementsSelection()  # 5 picked in the model

# group: working
python_script = Python(IN[0]=select_model_elements)
# ---------- python_script.python (104 lines) ----------
import clr
import sys

# Import RevitAPI
clr.AddReference('RevitAPI')
from Autodesk.Revit.DB import *
# Import RevitAPIUI
clr.AddReference('RevitAPIUI')
# Import DocumentManager and TransactionManager
clr.AddReference('RevitServices')
import RevitServices
from RevitServices.Persistence import DocumentManager
from RevitServices.Transactions import TransactionManager


clr.AddReference("RevitNodes")
import Revit
# Import ToProtoType, ToRevitType geometry conversion extension methods
clr.ImportExtensions(Revit.GeometryConversion)



# Import Dynamo Python References
clr.AddReference('ProtoGeometry')
from Autodesk.DesignScript.Geometry import *

# Assign Labels to Revit Document and Application
doc = DocumentManager.Instance.CurrentDBDocument
app = DocumentManager.Instance.CurrentUIApplication.Application


doc = DocumentManager.Instance.CurrentDBDocument
uiapp = DocumentManager.Instance.CurrentUIApplication
app = uiapp.Application

opt = Options()
opt.ComputeReferences = True
opt.IncludeNonVisibleObjects = True
#opt.View = doc.ActiveView
opt.DetailLevel = ViewDetailLevel.Medium


beam = UnwrapElement(IN[0])

def BeamEndPoints_SolidGeom(beam):
	opt = Options()
	opt.ComputeReferences = True
	opt.IncludeNonVisibleObjects = True
	#opt.View = doc.ActiveView
	opt.DetailLevel = ViewDetailLevel.Medium
	pts = []
	geo = beam.get_Geometry(opt)
	for g in geo:
		try:
			pts.append([g.Faces[0].Origin.ToPoint(),g.Faces[1].Origin.ToPoint()])
		except:
			""
	return pts[0]



def BeamEndPoints_InstaGeom(beam):
	opt = Options()
	opt.ComputeReferences = True
	opt.IncludeNonVisibleObjects = True
	#opt.View = doc.ActiveView
	opt.DetailLevel = ViewDetailLevel.Medium
	
	geo = beam.get_Geometry(opt)
	solids = []
	
	for item in geo:
		try:
			solids.append(item.GetInstanceGeometry())
		except:
			""
	faces = [solid.Faces for solid in solids[0]]
	bb1 = faces[1][0].Origin
	bb2 = faces[1][1].Origin
	return [bb1.ToPoint(), bb2.ToPoint()]


def ExtractBeamEndPts(beamList):
	geo = []
	check = []
	for b in beam:
		geo = b.get_Geometry(opt)
		subList = []
		check.append(subList)
		for g in geo:
			if g.GetType().ToString() == "Autodesk.Revit.DB.Solid":
				subList.append("Solid")
			else:
				subList.append("Instance")
	ptsList = []	
	for c,b in zip(check,beam):
		if "Solid" in c:
			ptsList.append(BeamEndPoints_SolidGeom(b))
		else:
			ptsList.append(BeamEndPoints_InstaGeom(b))
	return ptsList

	
OUT = ExtractBeamEndPts(beam)
# ----------------------------------------

deconstruct = List.Deconstruct(list=python_script, lacing=Longest)
byStartPointEndPoint = Line.ByStartPointEndPoint(startPoint=deconstruct.first, endPoint=deconstruct.rest)
byCurve = ModelCurve.ByCurve(byStartPointEndPoint)
select_model_elements_2 = DSModelElementsSelection()  # 10 picked in the model
python_script_2 = Python(IN[0]=select_model_elements_2)
# ---------- python_script_2.python (66 lines) ----------
import clr
import sys

# Import RevitAPI
clr.AddReference('RevitAPI')
from Autodesk.Revit.DB import *
# Import RevitAPIUI
clr.AddReference('RevitAPIUI')
# Import DocumentManager and TransactionManager
clr.AddReference('RevitServices')
import RevitServices
from RevitServices.Persistence import DocumentManager
from RevitServices.Transactions import TransactionManager


clr.AddReference("RevitNodes")
import Revit
# Import ToProtoType, ToRevitType geometry conversion extension methods
clr.ImportExtensions(Revit.GeometryConversion)



# Import Dynamo Python References
clr.AddReference('ProtoGeometry')
from Autodesk.DesignScript.Geometry import *

# Assign Labels to Revit Document and Application
doc = DocumentManager.Instance.CurrentDBDocument
app = DocumentManager.Instance.CurrentUIApplication.Application


doc = DocumentManager.Instance.CurrentDBDocument
uiapp = DocumentManager.Instance.CurrentUIApplication
app = uiapp.Application


beam = UnwrapElement(IN[0])

def GetBeamExactCurve(beam):
	opt = Options()
	opt.ComputeReferences = True
	opt.IncludeNonVisibleObjects = True
	opt.View = doc.ActiveView

	geo = beam.get_Geometry(opt)
	solids = []
	
	for item in geo:
		try:
			solids.append(item.GetInstanceGeometry())
		except:
			""
	faces = [solid.Faces for solid in solids[0]]
	bb1 = faces[1][0].Origin
	bb2 = faces[1][1].Origin
	return [bb1.ToPoint(), bb2.ToPoint()]

errors = []

for b in beam:
	try:
		GetBeamExactCurve(b)
	except:
		errors.append(b)
		
OUT = errors
# ----------------------------------------
byCurve_2 = ModelCurve.ByCurve()  # unwired: arg0
code_block_2 = CodeBlock { a[0]; }  # unwired: a
python_script_3 = Python(IN[0]=code_block_2)
# ---------- python_script_3.python (94 lines) ----------
# Default imports
import clr

# Import RevitAPI
clr.AddReference("RevitAPI")
import Autodesk
from Autodesk.Revit.DB import *

# Import DocumentManager and TransactionManager
clr.AddReference("RevitServices")
import RevitServices
from RevitServices.Persistence import DocumentManager
from RevitServices.Transactions import TransactionManager

# Import ToDSType(bool) extension method
clr.AddReference("RevitNodes")
import Revit
clr.ImportExtensions(Revit.Elements)

#The input to this node will be stored in the IN[0] variable.

doc =  DocumentManager.Instance.CurrentDBDocument
app =  DocumentManager.Instance.CurrentUIApplication.Application

solids = IN[0]

faces = []
edges = []
vertices = []
if hasattr(solids, "__iter__"):
	for solid in solids:
		if hasattr(solid, "__iter__"):
			for sol in solid:
				fcs = []
				edgs = []
				verts = []
				for face in solid.Faces:
					fcs.append(face)
	
				for edge in solid.Edges:
					crv = edge.AsCurve()
					edgs.append(crv)
		
					pt = crv.Evaluate(0, True)
					verts.append(pt)
		
				faces.append(fcs)
				edges.append(edgs)
				vertices.append(verts)
		else:
			fcs = []
			edgs = []
			verts = []
			for face in solid.Faces:
				fcs.append(face)
	
			for edge in solid.Edges:
				crv = edge.AsCurve()
				edgs.append(crv)
		
				pt = crv.Evaluate(0, True)
				verts.append(pt)
		
			faces.append(fcs)
			edges.append(edgs)
			vertices.append(verts)
else:
	fcs = []
	edgs = []
	verts = []
	for face in solids.Faces:
		fcs.append(face)
	
	for edge in solids.Edges:
		crv = edge.AsCurve()
		edgs.append(crv)
		
		pt = crv.Evaluate(0, True)
		verts.append(pt)
		
	faces.append(fcs)
	edges.append(edgs)
	vertices.append(verts)

	
	
output = []
output.append(faces)
output.append(edges)
output.append(vertices)
	

#Assign your output to the OUT variable
OUT = output
# ----------------------------------------
python_script_4 = Python(IN[0]=code_block_2)
# ---------- python_script_4.python (68 lines) ----------
import clr
import sys

# Import RevitAPI
clr.AddReference('RevitAPI')
from Autodesk.Revit.DB import *
# Import RevitAPIUI
clr.AddReference('RevitAPIUI')
# Import DocumentManager and TransactionManager
clr.AddReference('RevitServices')
import RevitServices
from RevitServices.Persistence import DocumentManager
from RevitServices.Transactions import TransactionManager


clr.AddReference("RevitNodes")
import Revit
# Import ToProtoType, ToRevitType geometry conversion extension methods
clr.ImportExtensions(Revit.GeometryConversion)



# Import Dynamo Python References
clr.AddReference('ProtoGeometry')
from Autodesk.DesignScript.Geometry import *

# Assign Labels to Revit Document and Application
doc = DocumentManager.Instance.CurrentDBDocument
app = DocumentManager.Instance.CurrentUIApplication.Application


doc = DocumentManager.Instance.CurrentDBDocument
uiapp = DocumentManager.Instance.CurrentUIApplication
app = uiapp.Application


solids = UnwrapElement(IN[0])

opt = Options()
opt.ComputeReferences = True
opt.IncludeNonVisibleObjects = True
opt.View = doc.ActiveView

faces = []
fcs = []

if hasattr(solids, "__iter__"):
	for solid in solids:
		fcs = []
		edgs = []
		verts = []
		for face in solid.Faces:
			fcs.append(face)
		faces.append(fcs)


else:
	""
	
new = []

#if hasattr(solids, "__iter__"):

for solid in solids:
	for face in solid.Faces:
		new.append(face)

OUT = new
# ----------------------------------------
code_block_3 = CodeBlock(a=select_model_elements) { a[1]; }

# group: geometry instance
python_script_5 = Python(IN[0]=select_model_elements)
# ---------- python_script_5.python (67 lines) ----------
import clr
import sys

# Import RevitAPI
clr.AddReference('RevitAPI')
from Autodesk.Revit.DB import *
# Import RevitAPIUI
clr.AddReference('RevitAPIUI')
# Import DocumentManager and TransactionManager
clr.AddReference('RevitServices')
import RevitServices
from RevitServices.Persistence import DocumentManager
from RevitServices.Transactions import TransactionManager


clr.AddReference("RevitNodes")
import Revit
# Import ToProtoType, ToRevitType geometry conversion extension methods
clr.ImportExtensions(Revit.GeometryConversion)



# Import Dynamo Python References
clr.AddReference('ProtoGeometry')
from Autodesk.DesignScript.Geometry import *

# Assign Labels to Revit Document and Application
doc = DocumentManager.Instance.CurrentDBDocument
app = DocumentManager.Instance.CurrentUIApplication.Application


doc = DocumentManager.Instance.CurrentDBDocument
uiapp = DocumentManager.Instance.CurrentUIApplication
app = uiapp.Application


beam = UnwrapElement(IN[0])

def GetBeamExactCurve(beam):
	opt = Options()
	opt.ComputeReferences = True
	opt.IncludeNonVisibleObjects = True
	#opt.View = doc.ActiveView
	opt.DetailLevel = ViewDetailLevel.Medium
	
	geo = beam.get_Geometry(opt)
	solids = []
	
	for item in geo:
		try:
			solids.append(item.GetInstanceGeometry())
		except:
			""
	faces = [solid.Faces for solid in solids[0]]
	bb1 = faces[1][0].Origin
	bb2 = faces[1][1].Origin
	return [bb1.ToPoint(), bb2.ToPoint()]

errors = []
pts = []
for b in beam:
	try:
		pts.append(GetBeamExactCurve(b))
	except:
		errors.append(b)
		
OUT = pts, errors
# ----------------------------------------

code_block_4 = CodeBlock(a=python_script_5) { a[0]; }
python_script_6 = Python(IN[0]=python_script_5)  # same code as python_script_5
code_block_5 = CodeBlock(a=select_model_elements) { a[0]; }
code_block_6 = CodeBlock(a=code_block_5) { {a}; }

# group: solid instance
python_script_7 = Python(IN[0]=code_block_6)
# ---------- python_script_7.python (102 lines) ----------
import clr
import sys

# Import RevitAPI
clr.AddReference('RevitAPI')
from Autodesk.Revit.DB import *
# Import RevitAPIUI
clr.AddReference('RevitAPIUI')
# Import DocumentManager and TransactionManager
clr.AddReference('RevitServices')
import RevitServices
from RevitServices.Persistence import DocumentManager
from RevitServices.Transactions import TransactionManager


clr.AddReference("RevitNodes")
import Revit
# Import ToProtoType, ToRevitType geometry conversion extension methods
clr.ImportExtensions(Revit.GeometryConversion)



# Import Dynamo Python References
clr.AddReference('ProtoGeometry')
from Autodesk.DesignScript.Geometry import *

# Assign Labels to Revit Document and Application
doc = DocumentManager.Instance.CurrentDBDocument
app = DocumentManager.Instance.CurrentUIApplication.Application


doc = DocumentManager.Instance.CurrentDBDocument
uiapp = DocumentManager.Instance.CurrentUIApplication
app = uiapp.Application


beam = UnwrapElement(IN[0])

opt = Options()
opt.ComputeReferences = True
opt.IncludeNonVisibleObjects = True
#opt.View = doc.ActiveView
opt.DetailLevel = ViewDetailLevel.Medium

geoObj = []



def GetBeamExactCurve(beam):
	opt = Options()
	opt.ComputeReferences = True
	opt.IncludeNonVisibleObjects = True
	#opt.View = doc.ActiveView
	opt.DetailLevel = ViewDetailLevel.Medium
	
	geo = beam.get_Geometry(opt)
	solids = []
	
	for item in geo:
		try:
			solids.append(item.GetInstanceGeometry())
		except:
			""
	faces = [solid.Faces for solid in solids[0]]
	bb1 = faces[1][0].Origin
	bb2 = faces[1][1].Origin
	return [bb1.ToPoint(), bb2.ToPoint()]



def BeamEndPoints_SolidGeom(beam):
	opt = Options()
	opt.ComputeReferences = True
	opt.IncludeNonVisibleObjects = True
	#opt.View = doc.ActiveView
	opt.DetailLevel = ViewDetailLevel.Medium
	pts = []
	geo = beam.get_Geometry(opt)
	for g in geo:
		try:
			pts.append([g.Faces[0].Origin.ToPoint(),g.Faces[1].Origin.ToPoint()])
		except:
			""
	return pts[0]



solids = []
pts = []
errors = []
"""
for b in beam:
	geo = b.get_Geometry(opt)
	for g in geo:
		try:
			geoObj.append([g.Faces[0].Origin.ToPoint(),g.Faces[1].Origin.ToPoint()])
		except:
			""
"""


OUT = [GetBeamExactCurve2(b) for b in beam]
# ----------------------------------------

code_block_7 = CodeBlock(a=python_script_5) { a[1]; }
python_script_8 = Python()  # unwired: IN[0]
# ---------- python_script_8.python (69 lines) ----------
import clr
import sys

# Import RevitAPI
clr.AddReference('RevitAPI')
from Autodesk.Revit.DB import *
# Import RevitAPIUI
clr.AddReference('RevitAPIUI')
# Import DocumentManager and TransactionManager
clr.AddReference('RevitServices')
import RevitServices
from RevitServices.Persistence import DocumentManager
from RevitServices.Transactions import TransactionManager


clr.AddReference("RevitNodes")
import Revit
# Import ToProtoType, ToRevitType geometry conversion extension methods
clr.ImportExtensions(Revit.GeometryConversion)



# Import Dynamo Python References
clr.AddReference('ProtoGeometry')
from Autodesk.DesignScript.Geometry import *

# Assign Labels to Revit Document and Application
doc = DocumentManager.Instance.CurrentDBDocument
app = DocumentManager.Instance.CurrentUIApplication.Application


doc = DocumentManager.Instance.CurrentDBDocument
uiapp = DocumentManager.Instance.CurrentUIApplication
app = uiapp.Application


beam = UnwrapElement(IN[0])

def GetBeamExactCurve(beam):
	opt = Options()
	opt.ComputeReferences = True
	opt.IncludeNonVisibleObjects = True
	#opt.View = doc.ActiveView
	opt.DetailLevel = ViewDetailLevel.Medium
	
	geo = beam.get_Geometry(opt)
	solids = []
	pts = []
	for item in geo:
		try:
			solids = item.GetInstanceGeometry()
			faces = [solid.Faces for solid in solids[0]]
			bb1 = faces[1][0].Origin
			bb2 = faces[1][1].Origin
			pts.append(bb1.ToPoint(), bb2.ToPoint())
		except:
#			pts.append([item.Faces[0].Origin.ToPoint(),item.Faces[1].Origin.ToPoint()])
			""
	return pts

errors = []
pts = []
for b in beam:
	try:
		pts.append(GetBeamExactCurve(b))
	except:
		errors.append(b)
		
OUT = pts, errors
# ----------------------------------------
python_script_9 = Python(IN[0]=select_model_elements)
# ---------- python_script_9.python (53 lines) ----------
import clr
import sys

# Import RevitAPI
clr.AddReference('RevitAPI')
from Autodesk.Revit.DB import *
# Import RevitAPIUI
clr.AddReference('RevitAPIUI')
# Import DocumentManager and TransactionManager
clr.AddReference('RevitServices')
import RevitServices
from RevitServices.Persistence import DocumentManager
from RevitServices.Transactions import TransactionManager


clr.AddReference("RevitNodes")
import Revit
# Import ToProtoType, ToRevitType geometry conversion extension methods
clr.ImportExtensions(Revit.GeometryConversion)



# Import Dynamo Python References
clr.AddReference('ProtoGeometry')
from Autodesk.DesignScript.Geometry import *

# Assign Labels to Revit Document and Application
doc = DocumentManager.Instance.CurrentDBDocument
app = DocumentManager.Instance.CurrentUIApplication.Application


doc = DocumentManager.Instance.CurrentDBDocument
uiapp = DocumentManager.Instance.CurrentUIApplication
app = uiapp.Application

opt = Options()
opt.ComputeReferences = True
opt.IncludeNonVisibleObjects = True
#opt.View = doc.ActiveView
opt.DetailLevel = ViewDetailLevel.Medium


beam = UnwrapElement(IN[0])
geo = []

bol = []

for b in beam:
	geo = b.get_Geometry(opt)
	for g in geo:
		bol.append(g.GetType().ToString())
		
OUT = bol
# ----------------------------------------
code_block_8 = CodeBlock { "Solid"; }
contains = String.Contains(str=python_script_9, searchFor=code_block_8)
python_script_10 = Python(IN[0]=select_model_elements)
# ---------- python_script_10.python (99 lines) ----------
import clr
import sys

# Import RevitAPI
clr.AddReference('RevitAPI')
from Autodesk.Revit.DB import *
# Import RevitAPIUI
clr.AddReference('RevitAPIUI')
# Import DocumentManager and TransactionManager
clr.AddReference('RevitServices')
import RevitServices
from RevitServices.Persistence import DocumentManager
from RevitServices.Transactions import TransactionManager


clr.AddReference("RevitNodes")
import Revit
# Import ToProtoType, ToRevitType geometry conversion extension methods
clr.ImportExtensions(Revit.GeometryConversion)



# Import Dynamo Python References
clr.AddReference('ProtoGeometry')
from Autodesk.DesignScript.Geometry import *

# Assign Labels to Revit Document and Application
doc = DocumentManager.Instance.CurrentDBDocument
app = DocumentManager.Instance.CurrentUIApplication.Application


doc = DocumentManager.Instance.CurrentDBDocument
uiapp = DocumentManager.Instance.CurrentUIApplication
app = uiapp.Application

opt = Options()
opt.ComputeReferences = True
opt.IncludeNonVisibleObjects = True
#opt.View = doc.ActiveView
opt.DetailLevel = ViewDetailLevel.Medium


beam = UnwrapElement(IN[0])

def BeamEndPoints_SolidGeom(beam):
	opt = Options()
	opt.ComputeReferences = True
	opt.IncludeNonVisibleObjects = True
	#opt.View = doc.ActiveView
	opt.DetailLevel = ViewDetailLevel.Medium
	pts = []
	geo = beam.get_Geometry(opt)
	for g in geo:
		try:
			pts.append([g.Faces[0].Origin.ToPoint(),g.Faces[1].Origin.ToPoint()])
		except:
			""
	return pts[0]



def BeamEndPoints_InstaGeom(beam):
	opt = Options()
	opt.ComputeReferences = True
	opt.IncludeNonVisibleObjects = True
	opt.DetailLevel = ViewDetailLevel.Medium
	geo = beam.get_Geometry(opt)
	solids = []
	pts = []
	for item in geo:
		try:
			solids.append(item.GetInstanceGeometry())
		except:
			""
	try:
		faces = [solid.Faces for solid in solids[0]]
		pts.append([faces[1][0].Origin, faces[1][1].Origin])
	except:
		""
	return pts


def ExtractBeamEndPts(beam):
	check = []
	opt = Options()
	opt.ComputeReferences = True
	opt.IncludeNonVisibleObjects = True
	opt.DetailLevel = ViewDetailLevel.Medium
	geo = beam.get_Geometry(opt)
	ptsList = []	
	for g in geo:
		if g.GetType().ToString() == "Autodesk.Revit.DB.Solid":
			ptsList.append([g.Faces[0].Origin.ToPoint(),g.Faces[1].Origin.ToPoint()])
		else:
			""

	

OUT = [ExtractBeamEndPts(b) for b in beam]
# ----------------------------------------

# group: geometry instance
python_script_11 = Python()  # unwired: IN[0]
# ---------- python_script_11.python (60 lines) ----------
import clr
import sys

# Import RevitAPI
clr.AddReference('RevitAPI')
from Autodesk.Revit.DB import *
# Import RevitAPIUI
clr.AddReference('RevitAPIUI')
# Import DocumentManager and TransactionManager
clr.AddReference('RevitServices')
import RevitServices
from RevitServices.Persistence import DocumentManager
from RevitServices.Transactions import TransactionManager


clr.AddReference("RevitNodes")
import Revit
# Import ToProtoType, ToRevitType geometry conversion extension methods
clr.ImportExtensions(Revit.GeometryConversion)



# Import Dynamo Python References
clr.AddReference('ProtoGeometry')
from Autodesk.DesignScript.Geometry import *

# Assign Labels to Revit Document and Application
doc = DocumentManager.Instance.CurrentDBDocument
app = DocumentManager.Instance.CurrentUIApplication.Application


doc = DocumentManager.Instance.CurrentDBDocument
uiapp = DocumentManager.Instance.CurrentUIApplication
app = uiapp.Application


beam = UnwrapElement(IN[0])

def GetBeamExactCurve(beam):
	opt = Options()
	opt.ComputeReferences = True
	opt.IncludeNonVisibleObjects = True
	#opt.View = doc.ActiveView
	opt.DetailLevel = ViewDetailLevel.Medium
	
	geo = beam.get_Geometry(opt)
	solids = []
	
	for item in geo:
		try:
			solids.append(item.GetInstanceGeometry())
		except:
			""
	faces = [solid.Faces for solid in solids[0]]
	bb1 = faces[1][0].Origin
	bb2 = faces[1][1].Origin
	return [bb1.ToPoint(), bb2.ToPoint()]

		
OUT = GetBeamExactCurve(beam)
# ----------------------------------------

python_script_12 = Python(IN[0]=code_block_5)
# ---------- python_script_12.python (100 lines) ----------
import clr
import sys

# Import RevitAPI
clr.AddReference('RevitAPI')
from Autodesk.Revit.DB import *
# Import RevitAPIUI
clr.AddReference('RevitAPIUI')
# Import DocumentManager and TransactionManager
clr.AddReference('RevitServices')
import RevitServices
from RevitServices.Persistence import DocumentManager
from RevitServices.Transactions import TransactionManager


clr.AddReference("RevitNodes")
import Revit
# Import ToProtoType, ToRevitType geometry conversion extension methods
clr.ImportExtensions(Revit.GeometryConversion)



# Import Dynamo Python References
clr.AddReference('ProtoGeometry')
from Autodesk.DesignScript.Geometry import *

# Assign Labels to Revit Document and Application
doc = DocumentManager.Instance.CurrentDBDocument
app = DocumentManager.Instance.CurrentUIApplication.Application


doc = DocumentManager.Instance.CurrentDBDocument
uiapp = DocumentManager.Instance.CurrentUIApplication
app = uiapp.Application

opt = Options()
opt.ComputeReferences = True
opt.IncludeNonVisibleObjects = True
#opt.View = doc.ActiveView
opt.DetailLevel = ViewDetailLevel.Medium


beam = UnwrapElement(IN[0])

def BeamEndPoints_SolidGeom(beam):
	opt = Options()
	opt.ComputeReferences = True
	opt.IncludeNonVisibleObjects = True
	#opt.View = doc.ActiveView
	opt.DetailLevel = ViewDetailLevel.Medium
	pts = []
	geo = beam.get_Geometry(opt)
	for g in geo:
		try:
			pts.append([g.Faces[0].Origin.ToPoint(),g.Faces[1].Origin.ToPoint()])
		except:
			""
	return pts[0]



def BeamEndPoints_InstaGeom(beam):
	opt = Options()
	opt.ComputeReferences = True
	opt.IncludeNonVisibleObjects = True
	#opt.View = doc.ActiveView
	opt.DetailLevel = ViewDetailLevel.Medium
	geo = beam.get_Geometry(opt)
	solids = []
	pts = []
	for item in geo:
		try:
			solids.append(item.GetInstanceGeometry())
		except:
			""
	try:
		faces = [solid.Faces for solid in solids[0]]
		pts.append([faces[1][0].Origin, faces[1][1].Origin])
	except:
		""
	return pts


def ExtractBeamEndPts(beam):
	check = []
	geo = beam.get_Geometry(opt)
	for g in geo:
		if g.GetType().ToString() == "Autodesk.Revit.DB.Solid":
			check.append("Solid")
		else:
			check.append("Instance")
	ptsList = []	
	if check == "Solid":
		ptsList.append(BeamEndPoints_SolidGeom(beam))
	else:
		ptsList.append(BeamEndPoints_InstaGeom(beam))
	return ptsList
	

OUT = ExtractBeamEndPts(beam)
# ----------------------------------------
