# Dynamo graph Arc.dyn (Dynamo 1.2.3.592)

# group: CHORDS
code_block = CodeBlock { Autodesk.Point.ByCoordinates(0,0,0); }
code_block_2 = CodeBlock { 6000; }
code_block_3 = CodeBlock { 0; }
code_block_4 = CodeBlock { 180; }
code_block_5 = CodeBlock { Vector.YAxis(); }
reverse = Vector.Reverse(code_block_5)
byCenterPointRadiusAngle = Arc.ByCenterPointRadiusAngle(center=code_block, radius=code_block_2, startAngle=code_block_3, endAngle=code_block_4, normal=reverse)
code_block_6 = CodeBlock { -2000; }
offset = Curve.Offset(curve=byCenterPointRadiusAngle, distance=code_block_6)
levels = Levels("00")
structural_framing_types = StructuralFramingTypes("RHS550x350x16 #")

# group: VERTICALS
code_block_7 = CodeBlock { 12; }
code_block_8 = CodeBlock(Division=code_block_7) { 0..1..#Division; }
pointAtParameter = Curve.PointAtParameter(curve=byCenterPointRadiusAngle, param=code_block_8)
code_block_9 = CodeBlock(Division=code_block_7) { 0..1..#Division; }
pointAtParameter_2 = Curve.PointAtParameter(curve=offset, param=code_block_9)
byStartPointEndPoint = Line.ByStartPointEndPoint(startPoint=pointAtParameter, endPoint=pointAtParameter_2)
levels_2 = Levels("00")
structural_framing_types_2 = StructuralFramingTypes("RHS350x150x16 #")
beamByCurve = StructuralFraming.BeamByCurve(curve=byStartPointEndPoint, level=levels_2, structuralFramingType=structural_framing_types_2)

code_block_10 = CodeBlock { 0; }
offset_2 = Curve.Offset(curve=byCenterPointRadiusAngle, distance=code_block_10)

# group (continued): CHORDS
join = List.Join(offset_2, offset)
beamByCurve_2 = StructuralFraming.BeamByCurve(curve=join, level=levels, structuralFramingType=structural_framing_types)

# group: DIAGONALS
code_block_11 = CodeBlock(a=code_block_7) { a-1; }
removeItemAtIndex = List.RemoveItemAtIndex(list=pointAtParameter_2, indices=code_block_11)
code_block_12 = CodeBlock { 0; }
removeItemAtIndex_2 = List.RemoveItemAtIndex(list=pointAtParameter, indices=code_block_12)
byStartPointEndPoint_2 = Line.ByStartPointEndPoint(startPoint=removeItemAtIndex_2, endPoint=pointAtParameter_2)
levels_3 = Levels("00")
structural_framing_types_3 = StructuralFramingTypes("RHS350x150x16 #")
beamByCurve_3 = StructuralFraming.BeamByCurve(curve=byStartPointEndPoint_2, level=levels_3, structuralFramingType=structural_framing_types_3)
