# Dynamo graph Auto coping.dyn (Dynamo 0.8.2.2392)

select_model_element = DSModelElementSelection()  # 1 picked in the model
addCoping = Custom[FamilyInstance.AddCoping](cuttingElement=select_model_element)  # Adds a coping (cut) to a steel beam
select_model_element_2 = DSModelElementSelection()  # 1 picked in the model
select_model_elements = DSModelElementsSelection()  # 5 picked in the model
map = List.Map()
select_model_element_3 = DSModelElementSelection()  # 1 picked in the model
map_2 = List.Map()
intersectionChecker = Custom[Tool.IntersectionChecker]()  # Checks if elements have a geometrical intersection. The result is a list of list, with First Element is checked against the others.
# note: Main Chords
select_model_elements_2 = DSModelElementsSelection()  # 207 picked in the model
select_model_elements_3 = DSModelElementsSelection()  # 112 picked in the model
code_block = CodeBlock { 1; }
getSurroundingElements = Custom[Tool.GetSurroundingElements](Element_s=select_model_elements_2, Element_s_to_check=select_model_elements_3, Tolerance=code_block)  # Get Surrounding Elements by Categories, group them as List. Tolerance distance available.
restOfItems = List.RestOfItems(getSurroundingElements, lacing=Longest)
code_block_2 = CodeBlock { 0; }
getItemAtIndex = List.GetItemAtIndex(list=getSurroundingElements, index=code_block_2, lacing=Longest)
python_script = Python(IN[0]=getItemAtIndex)
# ---------- python_script.python (14 lines) ----------
import clr
clr.AddReference('ProtoGeometry')
from Autodesk.DesignScript.Geometry import *
#The inputs to this node will be stored as a list in the IN variables.
lst = IN[0]
newlst = []

for l in lst:
	sub = []
	sub.append(l)
	newlst.append(sub)

#Assign your output to the OUT variable.
OUT = newlst
# ----------------------------------------
python_script_2 = Python(IN[0]=restOfItems, IN[1]=python_script)
# ---------- python_script_2.python (27 lines) ----------
import clr
import System
clr.AddReference('RevitAPI')
from Autodesk.Revit.DB import *

clr.AddReference("RevitServices")
import RevitServices
from RevitServices.Persistence import DocumentManager
from RevitServices.Transactions import TransactionManager

doc = DocumentManager.Instance.CurrentDBDocument
fams = UnwrapElement(IN[0])
cutters = UnwrapElement(IN[1])
booleans = list()
counter = 0

TransactionManager.Instance.EnsureInTransaction(doc)
for i in range(0,len(fams)):
	for j in range(0,len(fams[i])):
		try:
			fams[i][j].AddCoping(cutters[i][0])
			booleans.append(True)
		except:	booleans.append(False)
		
TransactionManager.Instance.TransactionTaskDone()

OUT = booleans
# ----------------------------------------
python_script_3 = Python()
# ---------- python_script_3.python (26 lines) ----------
import clr
import System
clr.AddReference('RevitAPI')
from Autodesk.Revit.DB import *

clr.AddReference("RevitServices")
import RevitServices
from RevitServices.Persistence import DocumentManager
from RevitServices.Transactions import TransactionManager

doc = DocumentManager.Instance.CurrentDBDocument
fams = UnwrapElement(IN[0])
cutters = UnwrapElement(IN[1])
booleans = list()
counter = 0

TransactionManager.Instance.EnsureInTransaction(doc)
for i in range(0,len(fams)):
	try:
		fams[i].AddCoping(cutters[0])
		booleans.append(True)
	except:	booleans.append(False)
	counter += 1
TransactionManager.Instance.TransactionTaskDone()

OUT = booleans
# ----------------------------------------
restOfItems_2 = List.RestOfItems(getSurroundingElements, lacing=Longest)
code_block_3 = CodeBlock(a=restOfItems_2) { a[0]; }
