# Dynamo graph ALIGN BEAMS.dyn (Dynamo 1.3.2.2480)

select_model_elements = DSModelElementsSelection()  # 500 picked in the model
location = StructuralFraming.Location(select_model_elements)
removeNulls = Lists.Manage.RemoveNulls(location)
startPoint = Curve.StartPoint(removeNulls)
endPoint = Curve.EndPoint(removeNulls)
byTwoPoints = Vector.ByTwoPoints(start=startPoint, end=endPoint)
code_block = CodeBlock { vector1 = Vector.ByTwoPoints(Autodesk.Point.ByCoordinates(0, 0, 0), Autodesk.Point.ByCoordinates(1000, 0, 0)); }
code_block_2 = CodeBlock { vector2 = Vector.ByTwoPoints(Autodesk.Point.ByCoordinates(0, 0, 0), Autodesk.Point.ByCoordinates(0, 0, 1000)); }
angleAboutAxis = Vector.AngleAboutAxis(byTwoPoints, code_block, code_block_2, lacing=Longest)
code_block_3 = CodeBlock { 1; }
round = Math.Round(number=angleAboutAxis, digits=code_block_3)
code_block_4 = CodeBlock { 90; }
lt = round < code_block_4  # lacing=Longest
code_block_5 = CodeBlock { 270; }
ge = round >= code_block_5  # lacing=Longest
xor = Logic.Xor(lt, ge)
filterByBoolMask = List.FilterByBoolMask(list=select_model_elements, mask=xor)
byStartPointEndPoint = Line.ByStartPointEndPoint(startPoint=endPoint, endPoint=startPoint)
filterByBoolMask_2 = List.FilterByBoolMask(list=byStartPointEndPoint, mask=xor)
setLocation = Element.SetLocation(filterByBoolMask.out, filterByBoolMask_2.out)
worksets = WorksetUi("Commercial Steelwork Framing - Beams")
byWorkset = archilab.Revit.Selection.Select.ByWorkset(worksets)
getCategory = Element.GetCategory(byWorkset)
type = Object.Type(getCategory)
categories = Categories("StructuralFraming")
type_2 = Object.Type(categories)
type_3 = archilab.Revit.Elements.Elements.Type(select_model_elements)
string_from_object = FromObject(categories)
string_from_object_2 = FromObject(getCategory)
eq = string_from_object == string_from_object_2  # lacing=Longest
filterByBoolMask_3 = List.FilterByBoolMask(list=byWorkset, mask=eq)
flatten = Flatten(filterByBoolMask_3.in)
ungroup = Custom[Group.Ungroup]()  # Ungroups a group and returns the ungrouped elements.; unwired: group
modelGroupByName = Custom[Collector.ModelGroupByName]()  # This will collect all instances of a model group by given name.; unwired: groupName
code_block_6 = CodeBlock { "Commercial Beams (North)"; }
ungroup_2 = Custom[Group.Ungroup](group=code_block_6)
members = Custom[Group.Members](group=code_block_6)  # Retrieves the members of a group
