# Dynamo graph Beam Offset to Column Offset.dyn (Dynamo 0.8.2.2392)

select_model_elements = DSModelElementsSelection()  # 5 picked in the model
code_block = CodeBlock { "Top Offset"; }
select_model_elements_2 = DSModelElementsSelection()
code_block_2 = CodeBlock { "Start Level Offset"; }
getParameterValueByName = Element.GetParameterValueByName(element=select_model_elements_2, parameterName=code_block_2)
setParameterByName = Element.SetParameterByName(element=select_model_elements, parameterName=code_block, value=getParameterValueByName)
code_block_3 = CodeBlock { "End Level Offset"; }
