# Dynamo graph Beam to Brace.dyn (Dynamo 0.8.2.2392)

code_block = CodeBlock { 1; }
pick_model_elements = Custom[Pick Model Elements](refresh=code_block)  # This node offers a pick method for selecting elements in Revit.
location = StructuralFraming.Location(pick_model_elements)
levels = Levels("G00 - ENTRANCE")
structural_framing_types = StructuralFramingTypes("UKC203x203x71")
braceByCurve = StructuralFraming.BraceByCurve(location, levels, structural_framing_types)
deleteElements = Custom[Doc.DeleteElements]()  # Attempts to delete the input list of elements from the active Revit document.The node returns the number of successfully deleted elements and their Ids as a string. Carefully observe the deleted elements count. It may be greater than the input list because hosted elements or tags will be deleted as well. If an element in the list can not be deleted (for example last revision or last view), the whole list will fail to be deleted.
