# Dynamo graph BeamCentreline.dyn (Dynamo 1.3.2.2480)

faces = Element.Faces()  # unwired: arg0
area = Surface.Area(faces)
code_block = CodeBlock { 0..1; }
getItemAtIndex = List.GetItemAtIndex(list=faces, index=code_block)
deconstructSurface = Geometry.Surfaces.DeconstructSurface(faces)
center = Polygon.Center()  # unwired: arg0
select_model_element = DSModelElementSelection()  # 1 picked in the model
python_script = Python(IN[0]=select_model_element)
# ---------- python_script.python (93 lines) ----------
import clr
import sys

# Import RevitAPI
clr.AddReference('RevitAPI')
from Autodesk.Revit.DB import *
# Import RevitAPIUI
clr.AddReference('RevitAPIUI')
# Import DocumentManager and TransactionManager
clr.AddReference('RevitServices')
import RevitServices
from RevitServices.Persistence import DocumentManager
from RevitServices.Transactions import TransactionManager


clr.AddReference("RevitNodes")
import Revit
# Import ToProtoType, ToRevitType geometry conversion extension methods
clr.ImportExtensions(Revit.GeometryConversion)



# Import Dynamo Python References
clr.AddReference('ProtoGeometry')
from Autodesk.DesignScript.Geometry import *

# Assign Labels to Revit Document and Application
doc = DocumentManager.Instance.CurrentDBDocument
app = DocumentManager.Instance.CurrentUIApplication.Application


doc = DocumentManager.Instance.CurrentDBDocument
uiapp = DocumentManager.Instance.CurrentUIApplication
app = uiapp.Application


beam = UnwrapElement(IN[0])

opt = Options()
opt.ComputeReferences = True
opt.IncludeNonVisibleObjects = True
opt.View = doc.ActiveView


solids = []

geo1 = beam.get_Geometry(opt)
enum1 = geo1.GetEnumerator() 

#; enum1.MoveNext()

#geo2 = enum1.Current.GetInstamceGeometry()

while enum1.MoveNext():
	item = enum1.Current
	try:
		#solids.append(item.GetSymbolGeometry())
		solids.append(item.GetInstanceGeometry())
	except:
		""

enum2 = solids.GetEnumerator()

faces = []

while enum2.MoveNext():
	item = enum2.Current
	try:
		faces.append(item.ComputeCentroid())
	except:
		""
new = []

"""
for solid in solids:
	for face in solid.Faces:
		new.append(face)




for g in geo2:
	s1 = g.Convert()
	if s1 !=None: solids.append(s1)

"""
noa = []
for solid in solids[0]:
	#for face in solid.Faces:
	#	new.append(face)
	noa.append(solid.Faces)
		
OUT = (noa[1][0].ToProtoType(), noa[1][1].ToProtoType())
# ----------------------------------------
boundingBox = Geometry.BoundingBox(python_script)
properties = Custom[BoundingBox.Properties](boundingBox=boundingBox)  # Retrieves the centroid, width, depth and height of a given bounding box
deconstruct = List.Deconstruct(list=properties.Centroid)
byStartPointEndPoint = Line.ByStartPointEndPoint(startPoint=deconstruct.first, endPoint=deconstruct.rest)
byCurve = ModelCurve.ByCurve(byStartPointEndPoint)
byCurve_2 = ModelCurve.ByCurve(python_script)
code_block_2 = CodeBlock(a=python_script) { a[0]; }
python_script_2 = Python(IN[0]=code_block_2)
# ---------- python_script_2.python (94 lines) ----------
# Default imports
import clr

# Import RevitAPI
clr.AddReference("RevitAPI")
import Autodesk
from Autodesk.Revit.DB import *

# Import DocumentManager and TransactionManager
clr.AddReference("RevitServices")
import RevitServices
from RevitServices.Persistence import DocumentManager
from RevitServices.Transactions import TransactionManager

# Import ToDSType(bool) extension method
clr.AddReference("RevitNodes")
import Revit
clr.ImportExtensions(Revit.Elements)

#The input to this node will be stored in the IN[0] variable.

doc =  DocumentManager.Instance.CurrentDBDocument
app =  DocumentManager.Instance.CurrentUIApplication.Application

solids = IN[0]

faces = []
edges = []
vertices = []
if hasattr(solids, "__iter__"):
	for solid in solids:
		if hasattr(solid, "__iter__"):
			for sol in solid:
				fcs = []
				edgs = []
				verts = []
				for face in solid.Faces:
					fcs.append(face)
	
				for edge in solid.Edges:
					crv = edge.AsCurve()
					edgs.append(crv)
		
					pt = crv.Evaluate(0, True)
					verts.append(pt)
		
				faces.append(fcs)
				edges.append(edgs)
				vertices.append(verts)
		else:
			fcs = []
			edgs = []
			verts = []
			for face in solid.Faces:
				fcs.append(face)
	
			for edge in solid.Edges:
				crv = edge.AsCurve()
				edgs.append(crv)
		
				pt = crv.Evaluate(0, True)
				verts.append(pt)
		
			faces.append(fcs)
			edges.append(edgs)
			vertices.append(verts)
else:
	fcs = []
	edgs = []
	verts = []
	for face in solids.Faces:
		fcs.append(face)
	
	for edge in solids.Edges:
		crv = edge.AsCurve()
		edgs.append(crv)
		
		pt = crv.Evaluate(0, True)
		verts.append(pt)
		
	faces.append(fcs)
	edges.append(edgs)
	vertices.append(verts)

	
	
output = []
output.append(faces)
output.append(edges)
output.append(vertices)
	

#Assign your output to the OUT variable
OUT = output
# ----------------------------------------
python_script_3 = Python(IN[0]=code_block_2)
# ---------- python_script_3.python (68 lines) ----------
import clr
import sys

# Import RevitAPI
clr.AddReference('RevitAPI')
from Autodesk.Revit.DB import *
# Import RevitAPIUI
clr.AddReference('RevitAPIUI')
# Import DocumentManager and TransactionManager
clr.AddReference('RevitServices')
import RevitServices
from RevitServices.Persistence import DocumentManager
from RevitServices.Transactions import TransactionManager


clr.AddReference("RevitNodes")
import Revit
# Import ToProtoType, ToRevitType geometry conversion extension methods
clr.ImportExtensions(Revit.GeometryConversion)



# Import Dynamo Python References
clr.AddReference('ProtoGeometry')
from Autodesk.DesignScript.Geometry import *

# Assign Labels to Revit Document and Application
doc = DocumentManager.Instance.CurrentDBDocument
app = DocumentManager.Instance.CurrentUIApplication.Application


doc = DocumentManager.Instance.CurrentDBDocument
uiapp = DocumentManager.Instance.CurrentUIApplication
app = uiapp.Application


solids = UnwrapElement(IN[0])

opt = Options()
opt.ComputeReferences = True
opt.IncludeNonVisibleObjects = True
opt.View = doc.ActiveView

faces = []
fcs = []

if hasattr(solids, "__iter__"):
	for solid in solids:
		fcs = []
		edgs = []
		verts = []
		for face in solid.Faces:
			fcs.append(face)
		faces.append(fcs)


else:
	""
	
new = []

#if hasattr(solids, "__iter__"):

for solid in solids:
	for face in solid.Faces:
		new.append(face)

OUT = new
# ----------------------------------------
