# Dynamo graph ChangeBeamLocationCurve.dyn (Dynamo 1.3.1.1736)

select_model_element = DSModelElementSelection()  # 1 picked in the model
python_script = Python(IN[0]=select_model_element)
# ---------- python_script.python (37 lines) ----------
import clr

clr.AddReference("RevitServices")
import RevitServices
from RevitServices.Persistence import DocumentManager
from RevitServices.Transactions import TransactionManager
doc = DocumentManager.Instance.CurrentDBDocument

clr.AddReference("RevitAPI")
import Autodesk
from Autodesk.Revit.DB import *

clr.AddReference("RevitNodes")
import Revit
clr.ImportExtensions(Revit.Elements)
clr.ImportExtensions(Revit.GeometryConversion)

clr.AddReference("System")
from System.Collections.Generic import List

beamElement = UnwrapElement(IN[0])

beamLine = beamElement.Location

TransactionManager.Instance.EnsureInTransaction(doc)

p1 = XYZ.Zero
p2 = XYZ(10, 20, 0)
newBeamLine = Line.CreateBound(p1, p2)

#Change the beam location line to a new line.
beamLine.Curve = newBeamLine;
            

TransactionManager.Instance.TransactionTaskDone()

OUT = beamElement
# ----------------------------------------
