# Dynamo graph ChangeBeamLocationCurve02.dyn (Dynamo 1.3.1.1736)

categories = Categories("StructuralFraming")
all_elements_of_category = ElementsOfCategory(categories)
categories_2 = Categories("StructuralColumns")
all_elements_of_category_2 = ElementsOfCategory(categories_2)
code_block = CodeBlock { 0; }
getSurroundingElements = Custom[Tool.GetSurroundingElements](Element=all_elements_of_category, ElementCheck=all_elements_of_category_2, Tolerance=code_block)  # Get Surrounding Elements by Categories, group them as List. Tolerance distance available.
deconstruct = List.Deconstruct(list=getSurroundingElements, lacing=Longest)
code_block_2 = CodeBlock(a=deconstruct.first) { a; }
location = StructuralFraming.Location(deconstruct.first, lacing=Longest)

# group: column location point
python_script = Python(IN[0]=deconstruct.rest)
# ---------- python_script.python (23 lines) ----------
import clr
import math
clr.AddReference('RevitAPI')
from Autodesk.Revit.DB import *

clr.AddReference("RevitNodes")
import Revit
clr.ImportExtensions(Revit.GeometryConversion)

items = UnwrapElement(IN[0])

pointList = []

for i in range(0,len(items)):
	pt = []
	pointList.append(pt)
	for j in range(0,len(items[i])):
		pt.append(items[i][j].Location.Point.ToPoint())




OUT = pointList
# ----------------------------------------

ZAxis = Vector.ZAxis()
code_block_3 = CodeBlock(curve1=location) { point1 = curve1.PointAtParameter(0.5).Z; }
translate = Geometry.Translate(geometry=python_script, direction=ZAxis, distance=code_block_3)
code_block_4 = CodeBlock { "Dimensions_Width_Nominal"; }
getParameterValueByName = Element.GetParameterValueByName(element=deconstruct.rest, parameterName=code_block_4)

# group: column diameter x factor
code_block_5 = CodeBlock { 1.5; }
mul = getParameterValueByName * code_block_5  # lacing=Longest

byCenterPointRadius = Circle.ByCenterPointRadius(centerPoint=translate, radius=mul)
intersect = Geometry.Intersect(geometry=location, other=byCenterPointRadius)
flatten = Flatten(intersect@L3)
count = List.Count(flatten, lacing=Longest)
code_block_6 = CodeBlock { 2; }
eq = count == code_block_6

# group: IN = 2 columns OUT = 1 column
filterByBoolMask = List.FilterByBoolMask(list=code_block_2, mask=eq)

code_block_7 = CodeBlock(a=filterByBoolMask.in) { a; }
filterByBoolMask_2 = List.FilterByBoolMask(list=flatten, mask=eq)
code_block_8 = CodeBlock(a=filterByBoolMask_2.in) { a; }

# group: change beam location curve
python_script_2 = Python(IN[0]=code_block_7, IN[1]=code_block_8)
# ---------- python_script_2.python (42 lines) ----------
import clr

clr.AddReference("RevitServices")
import RevitServices
from RevitServices.Persistence import DocumentManager
from RevitServices.Transactions import TransactionManager
doc = DocumentManager.Instance.CurrentDBDocument

clr.AddReference("RevitAPI")
import Autodesk
from Autodesk.Revit.DB import *

clr.AddReference("RevitNodes")
import Revit
clr.ImportExtensions(Revit.Elements)
clr.ImportExtensions(Revit.GeometryConversion)

clr.AddReference("System")
from System.Collections.Generic import List

beamElements = UnwrapElement(IN[0])
pts = UnwrapElement(IN[1])

beamLocations = []

for beam in beamElements:
	beamLocations.append(beam.Location)

newBeamLine = []

TransactionManager.Instance.EnsureInTransaction(doc)

for i in range(0,len(beamLocations)):
	newBeamLine = Line.CreateBound(pts[i][0].ToXyz(), pts[i][1].ToXyz())
	#Change the beam location line to a new line:
	beamLocations[i].Curve = newBeamLine;

            

TransactionManager.Instance.TransactionTaskDone()

OUT = beamElements
# ----------------------------------------

select_model_elements = DSModelElementsSelection()  # 1 picked in the model
select_model_elements_2 = DSModelElementsSelection()  # 2 picked in the model
code_block_9 = CodeBlock { a; }  # unwired: a
deconstruct_2 = List.Deconstruct(list=code_block_9, lacing=Longest)
location_2 = StructuralFraming.Location(deconstruct_2.first, lacing=Longest)
python_script_3 = Python(IN[0]=deconstruct_2.rest)  # same code as python_script
python_script_4 = Python()  # unwired: IN[0], IN[1], IN[2]
# ---------- python_script_4.python (31 lines) ----------
import clr
clr.AddReference('ProtoGeometry')
from Autodesk.DesignScript.Geometry import *
#The inputs to this node will be stored as a list in the IN variables.
pts = IN[0]

check = IN[1]

otherPts = IN[2]

newList = []
"""
for i in range(0,len(pts)):
	nL = []
	newList.append(nL)
	if check[i][0]<0.5:
		nL.append(pts[i][0])
		nL.append(otherPts[i][0])
	else:
		nL.append(otherPts[i][0])
		nL.append(pts[i][0])
"""
for i in range(0,len(pts)):
	nL = []
	newList.append(nL)
	nL.append(pts[i][0])
	nL.append(otherPts[i][0])


#Assign your output to the OUT variable.
OUT = newList
# ----------------------------------------
join = List.Join(filterByBoolMask_2.in)  # unwired: arg1
code_block_10 = CodeBlock(a=filterByBoolMask.out) { a; }
filterByBoolMask_3 = List.FilterByBoolMask(list=location, mask=eq)
code_block_11 = CodeBlock(a=filterByBoolMask_3.out) { a; }
code_block_12 = CodeBlock(a=code_block_11) { a; }
code_block_13 = CodeBlock(a=filterByBoolMask_2.out) { a; }
parameterAtPoint = Curve.ParameterAtPoint(curve=code_block_11, point=code_block_13)
code_block_14 = CodeBlock(a=filterByBoolMask_2.out) { a; }
python_script_5 = Python(IN[0]=code_block_12, IN[1]=parameterAtPoint, IN[2]=code_block_14)
# ---------- python_script_5.python (36 lines) ----------
import clr
clr.AddReference('ProtoGeometry')
from Autodesk.DesignScript.Geometry import *
#The inputs to this node will be stored as a list in the IN variables.
crvs = IN[0]

check = IN[1]

intersectionPts = IN[2]

newList = []
"""
for i in range(0,len(pts)):
	nL = []
	newList.append(nL)
	if check[i][0]<0.5:
		nL.append(pts[i][0])
		nL.append(otherPts[i][0])
	else:
		nL.append(otherPts[i][0])
		nL.append(pts[i][0])
"""
newPoints = []

for i in range(0,len(crvs)):
	np = []
	newPoints.append(np)
	if check[i][0]<0.5:
		np.append(intersectionPts[i][0])
		np.append(crvs[i].PointAtParameter(1))
	else:
		np.append(crvs[i].PointAtParameter(0))
		np.append(intersectionPts[i][0])
		
#Assign your output to the OUT variable.
OUT = newPoints
# ----------------------------------------

# group: change beam location curve
python_script_6 = Python(IN[0]=code_block_10, IN[1]=python_script_5)  # same code as python_script_2

code_block_15 = CodeBlock { 1..3; }
python_script_7 = Python(IN[0]=code_block_15)
# ---------- python_script_7.python (10 lines) ----------
import clr
clr.AddReference('ProtoGeometry')
from Autodesk.DesignScript.Geometry import *
#The inputs to this node will be stored as a list in the IN variables.
crvs = IN[0]

crvs.append(10)
		
#Assign your output to the OUT variable.
OUT = crvs
# ----------------------------------------
code_block_16 = CodeBlock { 0.5; }
lt = parameterAtPoint < code_block_16
code_block_17 = CodeBlock { 1; }
code_block_18 = CodeBlock { 0; }
if_ = If(test=lt, true=code_block_17, false=code_block_18)
pointAtParameter = Curve.PointAtParameter(curve=code_block_11, param=if_)
python_script_8 = Python(IN[0]=code_block_14, IN[1]=pointAtParameter)
# ---------- python_script_8.python (19 lines) ----------
import clr
clr.AddReference('ProtoGeometry')
from Autodesk.DesignScript.Geometry import *
#The inputs to this node will be stored as a list in the IN variables.
list1 = IN[0]

list2 = IN[1]

newList = []

for i in range(0,len(list1)):
	nL = []
	newList.append(nL)
	nL.append(list2[i][0])
	nL.append(list1[i][0])


#Assign your output to the OUT variable.
OUT = newList
# ----------------------------------------
