# Dynamo graph ChangeBeamLocationCurve03.dyn (Dynamo 1.3.1.1736)

select_model_elements = DSModelElementsSelection()  # 1 picked in the model
select_model_elements_2 = DSModelElementsSelection()  # 1 picked in the model
code_block = CodeBlock { a; }  # unwired: a
deconstruct = List.Deconstruct(list=code_block, lacing=Longest)
location = StructuralFraming.Location(deconstruct.first, lacing=Longest)
python_script = Python(IN[0]=deconstruct.rest)
# ---------- python_script.python (23 lines) ----------
import clr
import math
clr.AddReference('RevitAPI')
from Autodesk.Revit.DB import *

clr.AddReference("RevitNodes")
import Revit
clr.ImportExtensions(Revit.GeometryConversion)

items = UnwrapElement(IN[0])

pointList = []

for i in range(0,len(items)):
	pt = []
	pointList.append(pt)
	for j in range(0,len(items[i])):
		pt.append(items[i][j].Location.Point.ToPoint())




OUT = pointList
# ----------------------------------------
categories = Categories("StructuralFraming")
all_elements_of_category = ElementsOfCategory(categories)
categories_2 = Categories("StructuralColumns")
all_elements_of_category_2 = ElementsOfCategory(categories_2)
code_block_2 = CodeBlock { 0; }
getSurroundingElements = Custom[Tool.GetSurroundingElements](Element=all_elements_of_category, ElementCheck=all_elements_of_category_2, Tolerance=code_block_2)  # Get Surrounding Elements by Categories, group them as List. Tolerance distance available.
deconstruct_2 = List.Deconstruct(list=getSurroundingElements, lacing=Longest)
code_block_3 = CodeBlock(a=deconstruct_2.first) { a; }
location_2 = StructuralFraming.Location(deconstruct_2.first, lacing=Longest)

# group: column location point
python_script_2 = Python(IN[0]=deconstruct_2.rest)  # same code as python_script

ZAxis = Vector.ZAxis()
code_block_4 = CodeBlock(curve1=location_2) { point1 = curve1.PointAtParameter(0.5).Z; }
translate = Geometry.Translate(geometry=python_script_2, direction=ZAxis, distance=code_block_4)
code_block_5 = CodeBlock { "Dimensions_Width_Nominal"; }
getParameterValueByName = Element.GetParameterValueByName(element=deconstruct_2.rest, parameterName=code_block_5)

# group: column diameter x factor
code_block_6 = CodeBlock { 1; }
mul = getParameterValueByName * code_block_6  # lacing=Longest

byCenterPointRadius = Circle.ByCenterPointRadius(centerPoint=translate, radius=mul)
intersect = Geometry.Intersect(geometry=location_2, other=byCenterPointRadius)
flatten = Flatten(intersect@L3)
count = List.Count(flatten, lacing=Longest)
code_block_7 = CodeBlock { 2; }
eq = count == code_block_7

# group: IN = 2 columns OUT = 1 column
filterByBoolMask = List.FilterByBoolMask(list=code_block_3, mask=eq)

join = List.Join(filterByBoolMask.in, filterByBoolMask.out)
filterByBoolMask_2 = List.FilterByBoolMask(list=flatten, mask=eq)
filterByBoolMask_3 = List.FilterByBoolMask(list=location_2, mask=eq)
parameterAtPoint = Curve.ParameterAtPoint(curve=filterByBoolMask_3.out, point=filterByBoolMask_2.out)
python_script_3 = Python(IN[0]=filterByBoolMask_3.out, IN[1]=parameterAtPoint, IN[2]=filterByBoolMask_2.out)
# ---------- python_script_3.python (36 lines) ----------
import clr
clr.AddReference('ProtoGeometry')
from Autodesk.DesignScript.Geometry import *
#The inputs to this node will be stored as a list in the IN variables.
crvs = IN[0]

check = IN[1]

intersectionPts = IN[2]

newList = []
"""
for i in range(0,len(pts)):
	nL = []
	newList.append(nL)
	if check[i][0]<0.5:
		nL.append(pts[i][0])
		nL.append(otherPts[i][0])
	else:
		nL.append(otherPts[i][0])
		nL.append(pts[i][0])
"""
newPoints = []

for i in range(0,len(crvs)):
	np = []
	newPoints.append(np)
	if check[i][0]<0.5:
		np.append(intersectionPts[i][0])
		np.append(crvs[i].PointAtParameter(1))
	else:
		np.append(crvs[i].PointAtParameter(0))
		np.append(intersectionPts[i][0])
		
#Assign your output to the OUT variable.
OUT = newPoints
# ----------------------------------------
join_2 = List.Join(filterByBoolMask_2.in, python_script_3)
python_script_4 = Python(IN[0]=join, IN[1]=join_2)
# ---------- python_script_4.python (42 lines) ----------
import clr

clr.AddReference("RevitServices")
import RevitServices
from RevitServices.Persistence import DocumentManager
from RevitServices.Transactions import TransactionManager
doc = DocumentManager.Instance.CurrentDBDocument

clr.AddReference("RevitAPI")
import Autodesk
from Autodesk.Revit.DB import *

clr.AddReference("RevitNodes")
import Revit
clr.ImportExtensions(Revit.Elements)
clr.ImportExtensions(Revit.GeometryConversion)

clr.AddReference("System")
from System.Collections.Generic import List

beamElements = UnwrapElement(IN[0])
pts = UnwrapElement(IN[1])

beamLocations = []

for beam in beamElements:
	beamLocations.append(beam.Location)

newBeamLine = []

TransactionManager.Instance.EnsureInTransaction(doc)

for i in range(0,len(beamLocations)):
	newBeamLine = Line.CreateBound(pts[i][0].ToXyz(), pts[i][1].ToXyz())
	#Change the beam location line to a new line:
	beamLocations[i].Curve = newBeamLine;

            

TransactionManager.Instance.TransactionTaskDone()

OUT = beamElements
# ----------------------------------------
