# Dynamo graph ChangeBeamLocationCurve04.dyn (Dynamo 1.3.1.1736)

boolean = BoolSelector(false)
pick_model_elements = Custom[Pick Model Elements](refresh=boolean)  # This node offers a pick method for selecting elements in Revit.
code_block = CodeBlock(a=pick_model_elements) { {a}; }
pick_model_elements_2 = Custom[Pick Model Elements](refresh=boolean)
curves = Element.Curves(pick_model_elements_2)
code_block_2 = CodeBlock { {0,1}; }
pointAtParameter = Curve.PointAtParameter(curve=curves, param=code_block_2, lacing=Longest)
code_block_3 = CodeBlock(a=pointAtParameter) { {a}; }
python_script = Python(IN[0]=code_block, IN[1]=code_block_3)
# ---------- python_script.python (42 lines) ----------
import clr

clr.AddReference("RevitServices")
import RevitServices
from RevitServices.Persistence import DocumentManager
from RevitServices.Transactions import TransactionManager
doc = DocumentManager.Instance.CurrentDBDocument

clr.AddReference("RevitAPI")
import Autodesk
from Autodesk.Revit.DB import *

clr.AddReference("RevitNodes")
import Revit
clr.ImportExtensions(Revit.Elements)
clr.ImportExtensions(Revit.GeometryConversion)

clr.AddReference("System")
from System.Collections.Generic import List

beamElements = UnwrapElement(IN[0])
pts = UnwrapElement(IN[1])

beamLocations = []

for beam in beamElements:
	beamLocations.append(beam.Location)

newBeamLine = []

TransactionManager.Instance.EnsureInTransaction(doc)

for i in range(0,len(beamLocations)):
	newBeamLine = Line.CreateBound(pts[i][0].ToXyz(), pts[i][1].ToXyz())
	#Change the beam location line to a new line:
	beamLocations[i].Curve = newBeamLine;

            

TransactionManager.Instance.TransactionTaskDone()

OUT = beamElements
# ----------------------------------------

# group: select beam
select_model_element = DSModelElementSelection()

select_model_element_2 = DSModelElementSelection()

# group: SET BEAM LOCATIONS
boolean_2 = BoolSelector(true)
pick_model_elements_3 = Custom[Pick Model Elements](refresh=boolean_2)
pick_model_elements_4 = Custom[Pick Model Elements](refresh=boolean_2)
curves_2 = Element.Curves(pick_model_elements_4)
setLocation = Element.SetLocation(pick_model_elements_3, curves_2, lacing=Longest)

# group: CREATE MODEL LINES FROM DWG LINES
select_model_element_3 = DSModelElementSelection()
python_script_2 = Python(IN[0]=select_model_element_3)
# ---------- python_script_2.python (34 lines) ----------
#Copyright 2017. All rights reserved. Bimorph Consultancy LTD, 5 St Johns Lane, London EC1M 4BH www.bimorph.co.uk
#Written by Thomas Mahon @Thomas__Mahon info@bimorph.co.uk Package: bimorphNodes
#GitHub: https://github.com/ThomasMahon/bimorphNodes/
#Follow: facebook.com/bimorphBIM | linkedin.com/company/bimorph-bim | @bimorphBIM

import clr

# Import RevitAPI
clr.AddReference("RevitAPI")
import Autodesk
from Autodesk.Revit.DB import *

dwgImport = IN[0]

if isinstance(dwgImport, list):
	singleton = False
else:
	singleton = True
	dwgImport = [dwgImport]

layerList = []
for dwg in dwgImport:
	dwgAPI = UnwrapElement(dwg)
	catSub = dwgAPI.Category.SubCategories
	enum = catSub.GetEnumerator()
	
	subList = []
	while enum.MoveNext():
		layerName = enum.Current.Name
		subList.Add( layerName )
		
	layerList.append(subList)
		
OUT = layerList[0] if singleton else layerList  #Preserve behaviour of node prior to v2.1
# ----------------------------------------
code_block_4 = CodeBlock(a=python_script_2) { a[0]; }
boolean_3 = BoolSelector(true)
curvesFromCADLayers = CAD.CurvesFromCADLayers(select_model_element_3, code_block_4, boolean_3)

# group: MOVE 1 END
select_model_elements = DSModelElementsSelection()
code_block_5 = CodeBlock(a=select_model_elements) { a; }
select_model_element_4 = DSModelElementSelection()
code_block_6 = CodeBlock(a=select_model_element_4) { Autodesk.Point.ByCoordinates(a.X,a.Y,a.Z); }
code_block_7 = CodeBlock { 100; }
translate = Geometry.Translate(geometry=code_block_6, zTranslation=code_block_7)
location = Custom[Element.Location](element=select_model_elements)  # Returns the location of an element as an XYZ (or if it's line-based the start and end point of the line), along with some booleans to help filtering the results. Use this for some element types (e.g. walls or lines) that do not work with the built-in Get Family Instance Location node.
code_block_8 = CodeBlock(a=location.curveEndpoints) { a; }
distanceTo = Geometry.DistanceTo(geometry=translate, other=code_block_8)
code_block_9 = CodeBlock { 500; }
lt = distanceTo < code_block_9
filterByBoolMask = List.FilterByBoolMask(list=code_block_8, mask=lt)
code_block_10 = CodeBlock(a=filterByBoolMask.out) { a; }
byStartPointEndPoint = Line.ByStartPointEndPoint(startPoint=translate, endPoint=code_block_10)
setLocation_2 = Element.SetLocation(code_block_5, byStartPointEndPoint, lacing=Longest)

remapRange = Math.RemapRange()  # unwired: numbers
passthrough = Custom[Passthrough]()  # Forces a sequential order of execution. The node wired into the output of the Passthrough node will be executed *after* the node wired into the waitFor input (e.g. important for some Revit operations). The value of the passThrough input will be passed on to the node wired into the output port of the Passthrough node.; unwired: passThrough, waitFor
