# Dynamo graph Miter Beams.dyn (Dynamo 1.3.2.2480)

py_miter = Python()  # unwired: IN[0]
# ---------- py_miter.python (40 lines) ----------
#Copyright(c) 2015, Dimitar Venkov
# @5devene, dimitar.ven@gmail.com

import clr

clr.AddReference("RevitServices")
import RevitServices
from RevitServices.Persistence import DocumentManager
from RevitServices.Transactions import TransactionManager
doc = DocumentManager.Instance.CurrentDBDocument
uidoc=DocumentManager.Instance.CurrentUIApplication.ActiveUIDocument

clr.AddReference("RevitNodes")
import Revit
clr.ImportExtensions(Revit.Elements)

clr.AddReference("RevitAPI")
from Autodesk.Revit.DB import ElementId
from Autodesk.Revit.DB.Structure import StructuralFramingUtils

clr.AddReference("System")
from System.Collections.Generic import List as cList


beams = UnwrapElement(IN[0])

ExUt = []

TransactionManager.Instance.EnsureInTransaction(doc)
for b in beams:
	ExUt = b.ExtensionUtility
	ExUt.set_Extended(0, True)
	ExUt.set_Extended(1, True)
	#StructuralFramingUtils.DisallowJoinAtEnd(b,0)
	#StructuralFramingUtils.DisallowJoinAtEnd(b,1)
ids1 = [e.Id for e in beams]
ids2 = cList[ElementId](ids1)
uidoc.Selection.SetElementIds(ids2)
OUT = "%s beams corrected in Revit." %ids2.Count
TransactionManager.Instance.TransactionTaskDone()
# ----------------------------------------
select_model_elements = DSModelElementsSelection()  # 8 picked in the model
py_disallow_join = Python(IN[0]=select_model_elements)
# ---------- py_disallow_join.python (37 lines) ----------
#Copyright(c) 2015, Dimitar Venkov
# @5devene, dimitar.ven@gmail.com

import clr

clr.AddReference("RevitServices")
import RevitServices
from RevitServices.Persistence import DocumentManager
from RevitServices.Transactions import TransactionManager
doc = DocumentManager.Instance.CurrentDBDocument
uidoc=DocumentManager.Instance.CurrentUIApplication.ActiveUIDocument

clr.AddReference("RevitNodes")
import Revit
clr.ImportExtensions(Revit.Elements)

clr.AddReference("RevitAPI")
from Autodesk.Revit.DB import ElementId
from Autodesk.Revit.DB.Structure import StructuralFramingUtils

clr.AddReference("System")
from System.Collections.Generic import List as cList


beams = UnwrapElement(IN[0])

ExUt = []

TransactionManager.Instance.EnsureInTransaction(doc)
for b in beams:
	StructuralFramingUtils.DisallowJoinAtEnd(b,0)
	StructuralFramingUtils.DisallowJoinAtEnd(b,1)
ids1 = [e.Id for e in beams]
ids2 = cList[ElementId](ids1)
uidoc.Selection.SetElementIds(ids2)
OUT = "%s beams corrected in Revit." %ids2.Count
TransactionManager.Instance.TransactionTaskDone()
# ----------------------------------------
py_allow_join = Python()  # unwired: IN[0]
# ---------- py_allow_join.python (37 lines) ----------
#Copyright(c) 2015, Dimitar Venkov
# @5devene, dimitar.ven@gmail.com

import clr

clr.AddReference("RevitServices")
import RevitServices
from RevitServices.Persistence import DocumentManager
from RevitServices.Transactions import TransactionManager
doc = DocumentManager.Instance.CurrentDBDocument
uidoc=DocumentManager.Instance.CurrentUIApplication.ActiveUIDocument

clr.AddReference("RevitNodes")
import Revit
clr.ImportExtensions(Revit.Elements)

clr.AddReference("RevitAPI")
from Autodesk.Revit.DB import ElementId
from Autodesk.Revit.DB.Structure import StructuralFramingUtils

clr.AddReference("System")
from System.Collections.Generic import List as cList


beams = UnwrapElement(IN[0])

ExUt = []

TransactionManager.Instance.EnsureInTransaction(doc)
for b in beams:
	StructuralFramingUtils.AllowJoinAtEnd(b,0)
	StructuralFramingUtils.AllowJoinAtEnd(b,1)
ids1 = [e.Id for e in beams]
ids2 = cList[ElementId](ids1)
uidoc.Selection.SetElementIds(ids2)
OUT = "%s beams corrected in Revit." %ids2.Count
TransactionManager.Instance.TransactionTaskDone()
# ----------------------------------------
disallowJoins = Custom[StructuralFraming.DisallowJoins]()  # Disallow joins at start and/or end of selected Strucural Framing elements; unwired: elements, DisallowAtStart, DisallowAtEnd
