# Dynamo graph Purlin Angle.dyn (Dynamo 0.8.2.2392)

code_block = CodeBlock { Vector.ZAxis(); }
code_block_2 = CodeBlock { 1; }
pick_model_elements = Custom[Pick Model Elements](refresh=code_block_2)  # This node offers a pick method for selecting elements in Revit.
location = StructuralFraming.Location(pick_model_elements)
startPoint = Curve.StartPoint(location)
endPoint = Curve.EndPoint(location)
byTwoPoints = Vector.ByTwoPoints(start=startPoint, end=endPoint)
angleBetween = Vector.AngleBetween(code_block, byTwoPoints)
code_block_3 = CodeBlock(a=angleBetween) { a-90; }
