# Dynamo graph Built In Param.dyn (Dynamo 1.2.0.2514)

levels = Levels("00")
byLevel = StructuralPlanView.ByLevel(levels)
get_builtinparameter_name = ItemSelector("Depth Clipping | VIEW_BACK_CLIPPING | int | ReadWrite", byLevel)
get_built_in_parameter = Custom[Get Built In Parameter](ParameterNames=get_builtinparameter_name, Elements=byLevel)  # This node will take an input of a built in parameter name and element to return that parameters value.
set_builtin_parameter = Custom[Set BuiltIn Parameter]()  # This node will take an input of a built in parameter name and set that parameter to given value for given elements.; unwired: ParameterName, Elements, ParameterValues
set_builtin_parameter_2 = Custom[Set BuiltIn Parameter](ParameterName=get_builtinparameter_name)  # unwired: Elements, ParameterValues
code_block = CodeBlock { "VIEW_BACK_CLIPPING"; }
active_view = Custom[Active View]()  # Selects the current document's active view. Supports more view types than the built-in option. Will be depreciated once the bult in node works with all plan types.
code_block_2 = CodeBlock { 1; }
python_script = Python(IN[0]=code_block, IN[1]=active_view, IN[2]=code_block_2)
# ---------- python_script.python (122 lines) ----------
#Copyright(c) 2015, Konrad K Sobon
# @arch_laboratory, http://archi-lab.net

import clr
import sys
clr.AddReference('ProtoGeometry')
from Autodesk.DesignScript.Geometry import *

pyt_path = r'C:\Program Files (x86)\IronPython 2.7\Lib'
sys.path.append(pyt_path)

# Import Element wrapper extension methods
clr.AddReference("RevitNodes")
import Revit
clr.ImportExtensions(Revit.Elements)

# Import DocumentManager and TransactionManager
clr.AddReference("RevitServices")
import RevitServices
from RevitServices.Persistence import DocumentManager
from RevitServices.Transactions import TransactionManager

doc = DocumentManager.Instance.CurrentDBDocument
uiapp = DocumentManager.Instance.CurrentUIApplication
app = uiapp.Application

# Import RevitAPI
clr.AddReference("RevitAPI")
import Autodesk
from Autodesk.Revit.DB import *
import System

#The inputs to this node will be stored as a list in the IN variable.
dataEnteringNode = IN

paramName = IN[0]
elements = UnwrapElement(IN[1])
paramValues = IN[2]

#builtInParams = System.Enum.GetValues(VIEW_BACK_CLIPPING)

TransactionManager.Instance.EnsureInTransaction(doc)


bips = System.Enum.GetValues(BuiltInParameter)

test = []

for i in bips:
	if i.ToString() == paramName:
		test.append(i)
		param = elements[0].get_Parameter(test[0])
		param.Set(paramValues)

TransactionManager.Instance.TransactionTaskDone()




"""
def GetBuiltInParam(paramName):
	builtInParams = System.Enum.GetValues(BuiltInParameter)
	test = []
	for i in builtInParams:
		if i.ToString() == paramName:
			test.append(i)
			break
		else:
			continue
	return test[0]
"""
#OUT = GetBuiltInParam(paramName)

OUT = param



"""
if isinstance(IN[1], list):
	elements = []
	for i in IN[1]:
		elements.append(UnwrapElement(i))
else:
	elements = IN[1]
"""

"""
def GetBuiltInParam(paramName):
	builtInParams = System.Enum.GetValues(BuiltInParameter)
	test = []
	for i in builtInParams:
		if i.ToString() == paramName:
			test.append(i)
			break
		else:
			continue
	return test[0]


try:
	errorReport = None
	# "Start" the transaction
	TransactionManager.Instance.EnsureInTransaction(doc)
	
	bipName = GetBuiltInParam(paramName)
	for i, j in zip(elements, paramValues):
		param = i.get_Parameter(bipName)
		param.Set(j)
	
	# "End" the transaction
	TransactionManager.Instance.TransactionTaskDone()
except:
	# if error accurs anywhere in the process catch it
	import traceback
	errorReport = traceback.format_exc()

#Assign your output to the OUT variable
if errorReport == None:
	OUT = 0
else:
	OUT = errorReport
"""
# ----------------------------------------
watch = Watch(python_script)
get_revit_activeview = Custom[Get Revit ActiveView]()  # Active View
boundingBox = Geometry.BoundingBox(active_view)
