# Dynamo graph DesignLink.dyn (Dynamo 1.2.3.592)

file_path = Filename("C:\Program Files\Oasys\GSA 8.7\Samples\Non-linear\Suspension_Bridge.gwb")
openGsaModel = DesignLink.gsaInteraction.OpenGsaModel(file_path)
getGsaElements = DesignLink.gsaInteraction.GetGsaElements(openGsaModel)
byStartPointEndPoint = Line.ByStartPointEndPoint(startPoint=getGsaElements.out4, endPoint=getGsaElements.out6)
code_block = CodeBlock(a=getGsaElements.out7) { a; }
