# Dynamo graph GSA Open.dyn (Dynamo 1.2.3.592)

openGsaFile = UserInterface.OpenGsaFile.OpenGsaFile()
file_path = Filename("C:\Program Files\Oasys\GSA 8.7\Samples\Stair.gwb")
string_from_object = FromObject(file_path)
openFile = UserInterface.OpenGsaFile.OpenFile(openGsaFile, string_from_object)
