# Dynamo graph Home.dyn (Dynamo 1.2.3.592)

code_block = CodeBlock()
# ---------- code_block.designscript (8 lines) ----------
"
using System;

string aa = IN[0].ToString();


aa
";
# ----------------------------------------
code_block_2 = CodeBlock { "sa"; }
fromString = Scripting.CSharpScript.FromString(code_block, code_block_2)
code_block_3 = CodeBlock()
# ---------- code_block_3.designscript (11 lines) ----------
"
using System;

public string Bella()
{
string ciao = "ciao";
}

ciao

";
# ----------------------------------------
code_block_4 = CodeBlock()
# ---------- code_block_4.designscript (11 lines) ----------
"
public int Bella()
{
int ciao = 25;

return ciao;
}

Bella()

";
# ----------------------------------------
code_block_5 = CodeBlock()
# ---------- code_block_5.designscript (20 lines) ----------
"


Document doc = DocumentManager.Instance.CurrentDBDocument;

//int[] ids = new int[3] {(int)IN[0],(int)IN[1],(int)IN[2]};

int[] ids = new int[1] {(int)IN[0]};

//int[] ide = new int [(int)IN[0]];

List<Revit.Elements.Element>ints = new List<Revit.Elements.Element>();

foreach (int id in ids){
 ints.Add(doc.GetElement(new ElementId(id)).ToDSType(true));
 }

ints

";
# ----------------------------------------
code_block_6 = CodeBlock()
# ---------- code_block_6.designscript (13 lines) ----------
"
using System;



public double MultByTwo(double inputNumber = Convert.ToDouble(IN[0]))
{
 return inputNumber*3;
}

MultByTwo()

";
# ----------------------------------------
code_block_7 = CodeBlock { "cea"; }
code_block_8 = CodeBlock { "33"; }
code_block_9 = CodeBlock()
# ---------- code_block_9.designscript (13 lines) ----------
"
using System;

double inputNumber = Convert.ToDouble(IN[0]);

public double MultByTwo()
{
 return inputNumber*3;
}

MultByTwo()

";
# ----------------------------------------
code_block_10 = CodeBlock()
# ---------- code_block_10.designscript (13 lines) ----------
"
using System;

int inputNumber = Convert.ToInt16(IN[0]);

public int MultByTwo()
{
 return inputNumber*4;
}

MultByTwo()

";
# ----------------------------------------
code_block_11 = CodeBlock()
# ---------- code_block_11.designscript (13 lines) ----------
"
using System;

int saa = Convert.ToInt32(IN[0]);

int MultByTwo(int inputNumber)
{
 return inputNumber*3;
}

MultByTwo(saa)

";
# ----------------------------------------
number = DoubleInput(23)
code_block_12 = CodeBlock()
# ---------- code_block_12.designscript (13 lines) ----------
"
using System;



public Object MultByTwo(int inputNumber)
{
 return inputNumber*3;
}

MultByTwo(Convert.ToInt16(IN[0]))

";
# ----------------------------------------
code_block_13 = CodeBlock()
# ---------- code_block_13.designscript (26 lines) ----------
"
using System.Collections.Generic;
using Interop.gsa_8_7;
using UsageDataCollection;
using System.Runtime.InteropServices;
using System;

ComAuto GsaObj;
DataCollector myDataCollector;

public ComAuto OpenFile(string filePath, string DC)
{

GsaObj = new ComAuto();
GsaObj.SetLocale(Locale.LOC_EN_GB);
GsaObj.Open(filePath);
myDataCollector = new DataCollector();
myDataCollector.UsageStatistics(DC);
return GsaObj;

}

OpenFile(IN[0].ToString(), IN[1].ToString())


";
# ----------------------------------------
code_block_14 = CodeBlock { "ciao"; }
type = Object.Type(code_block_14)
code_block_15 = CodeBlock()
# ---------- code_block_15.designscript (13 lines) ----------
"
using System;



public string MultByTwo(string inputNumber)
{
 return inputNumber;
}

MultByTwo(IN[0].ToString())

";
# ----------------------------------------
code_block_16 = CodeBlock()
# ---------- code_block_16.designscript (9 lines) ----------
"
using System;

celo;

ciao = celo;

ciao
";
# ----------------------------------------
code_block_17 = CodeBlock { 'ciao'; }
code_block_18 = CodeBlock()
# ---------- code_block_18.designscript (35 lines) ----------
"
using System.Collections.Generic;
using Interop.gsa_8_7;
using UsageDataCollection;
using System.Runtime.InteropServices;
using System;

ComAuto GsaObj;
DataCollector myDataCollector;

public ComAuto OpenFile(string filePath, string DC)
{
            try
            {
                GsaObj = new ComAuto();
            }
             catch
            {
                COMException ex = new COMException();
                throw new System.Exception(ex.Message);
            }

GsaObj = new ComAuto();
GsaObj.SetLocale(Locale.LOC_EN_GB);
GsaObj.Open(filePath);
myDataCollector = new DataCollector();
myDataCollector.UsageStatistics(DC);
return GsaObj;

}


OpenFile(IN[0].ToString(), IN[1].ToString())

";
# ----------------------------------------
file_path = Filename("..\..\..\..\..\..\Program%20Files\Oasys\GSA%208.7\Samples\Stage.gwb")
code_block_19 = CodeBlock { "Get Element Numbers"; }
code_block_20 = CodeBlock(a=file_path, b=code_block_19) { {a,b}; }
file_path_2 = Filename("..\..\..\Visual%20Studio%202015\Projects\UserInterface\UserInterface\bin\Release\UsageDataCollection.dll")
file_path_3 = Filename("C:\Program Files\Oasys\GSA 8.7\Interop.Gsa_8_7.dll")
code_block_21 = CodeBlock(a=file_path_2, b=file_path_3) { {a,b}; }
fromString_2 = Scripting.CSharpScript.FromString(code_block_18, code_block_20, code_block_21)
type_2 = Object.Type(fromString_2)
