# Dynamo graph Interpreter.dyn (Dynamo 1.2.3.592)

select_model_elements = DSModelElementsSelection()  # 1 picked in the model
rvtEleCat = TheThreeMiserables.Andre.RvtEleCat(select_model_elements)
eleCat = TheThreeMiserables.Andre.EleCat(select_model_elements)
code_block = CodeBlock()
# ---------- code_block.designscript (27 lines) ----------
"
using System;
using System.Collections.Generic;
using System.Linq;
using System.Text;
using System.Threading.Tasks;
using Autodesk.Revit.DB;
using Revit.Elements;
using RevitServices.Persistence;
using RevitServices.Transactions;

Document doc = DocumentManager.Instance.CurrentDBDocument;

//int[] ids = new int[3] {(int)IN[0],(int)IN[1],(int)IN[2]};

int[] ids = new int[1] {(int)IN[0]};

//int[] ide = new int [(int)IN[0]];

List<Revit.Elements.Element>ints = new List<Revit.Elements.Element>();

foreach (int id in ids){
 ints.Add(doc.GetElement(new ElementId(id)).ToDSType(true));
 }
ints

";
# ----------------------------------------
code_block_2 = CodeBlock { 2325; }
fromString = Scripting.CSharpScript.FromString(code_block, code_block_2)
code_block_3 = CodeBlock { {22,23,24}; }
numero = TheThreeMiserables.Interprete.Numero(code_block_2)
