# Dynamo graph ChangeLineStyle.dyn (Dynamo 1.3.1.1736)

select_model_element = DSModelElementSelection()
select_model_element_2 = DSModelElementSelection()  # 1 picked in the model
parameters = Element.Parameters(select_model_element_2)
python_script = Python(IN[0]=select_model_element_2)  # unwired: IN[1], IN[2]
# ---------- python_script.python (94 lines) ----------
#Copyright(c) 2016, Dimitar Venkov
# @5devene, dimitar.ven@gmail.com

import clr
import math

clr.AddReference("RevitServices")
import RevitServices
from RevitServices.Persistence import DocumentManager
from RevitServices.Transactions import TransactionManager
doc = DocumentManager.Instance.CurrentDBDocument

clr.AddReference("RevitNodes")
import Revit
clr.ImportExtensions(Revit.Elements)
clr.ImportExtensions(Revit.GeometryConversion)

clr.AddReference("RevitAPI")
from Autodesk.Revit.DB import *

def tolist(obj1):
	if hasattr(obj1,"__iter__"): return obj1
	else: return [obj1]

def output1(l1):
	if len(l1) == 1: return l1[0]
	else: return l1

elements = UnwrapElement(tolist(IN[0]))
getModel = IN[1]

accepted_mc = "Autodesk.Revit.DB.ModelLine, Autodesk.Revit.DB.ModelArc, Autodesk.Revit.DB.ModelEllipse, Autodesk.Revit.DB.ModelHermiteSpline, Autodesk.Revit.DB.ModelNurbSpline"

def almost_eq(line, mc):
	line2 = mc.Location.Curve
	xyz1 = line.Evaluate(0.5, True)
	if not line2.IsBound:
		xyz2 = line2.Center
		try: xyz1 = line.Center
		except: pass
	else:
		xyz2 = line2.Evaluate(0.5, True)
	if xyz1.DistanceTo(xyz2) <= 0.0001:
		return True
	else:
		return False

def clean1(l1):
	for i in xrange(len(l1) ):
		l1[i] = [x for x in l1[i] if x != None]
	return l1

def getSketch(el1):
	try:
		sk1 = doc.GetElement(ElementId(el1.Id.IntegerValue - 1) )
	except:
		sk1 = None
	if not getModel and sk1 is not None and sk1.GetType().ToString() == 'Autodesk.Revit.DB.Sketch':
		profile = sk1.Profile
	else:
		t1 = SubTransaction(doc)
		t1.Start()
		deleted = doc.Delete(el1.Id)
		t1.RollBack()
		
		profile, mc = CurveArrArray(), []
		for d in deleted:
			test_el = doc.GetElement(d)
			el_type = test_el.GetType().ToString()
			if el_type == "Autodesk.Revit.DB.Sketch":
				profile = test_el.Profile
				if not getModel:
					break
			elif getModel and el_type in accepted_mc :
				mc.append(test_el)

	ordered_mc = [ [None] * i.Size for i in profile] if getModel else []
	curves = [ [None] * i.Size for i in profile]
	for i in xrange(profile.Size):
		for j in xrange(profile[i].Size):
			curves[i][j] = profile[i][j].ToProtoType()
			if getModel:
				for k in xrange(len(mc)):
					if almost_eq(profile[i][j], mc[k]):
						ordered_mc[i][j] = mc[k].ToDSType(True)
						del mc[k]
						break
						
	return curves, clean1(ordered_mc)

TransactionManager.Instance.EnsureInTransaction(doc)
result = map(getSketch, elements)
TransactionManager.Instance.TransactionTaskDone()
OUT = output1([r[0] for r in result]), output1([r[1] for r in result])
# ----------------------------------------
elementSketch = Custom[Springs.Collector.ElementSketch]()  # Get the actual sketch lines of a sketch based element (floor, ceiling, modified wall, etc.) . You can optionally fetch the matching model curves, however this might prove comptationally heavy on larger data sets.; unwired: element
python_script_2 = Python(IN[0]=select_model_element_2)  # unwired: IN[1], IN[2]
# ---------- python_script_2.python (93 lines) ----------
#Copyright(c) 2016, Dimitar Venkov
# @5devene, dimitar.ven@gmail.com

import clr
import math

clr.AddReference("RevitServices")
import RevitServices
from RevitServices.Persistence import DocumentManager
from RevitServices.Transactions import TransactionManager
doc = DocumentManager.Instance.CurrentDBDocument

clr.AddReference("RevitNodes")
import Revit
clr.ImportExtensions(Revit.Elements)
clr.ImportExtensions(Revit.GeometryConversion)

clr.AddReference("RevitAPI")
from Autodesk.Revit.DB import *

def tolist(obj1):
	if hasattr(obj1,"__iter__"): return obj1
	else: return [obj1]

def output1(l1):
	if len(l1) == 1: return l1[0]
	else: return l1

elements = UnwrapElement(tolist(IN[0]))
getModel = IN[1]

accepted_mc = "Autodesk.Revit.DB.ModelLine, Autodesk.Revit.DB.ModelArc, Autodesk.Revit.DB.ModelEllipse, Autodesk.Revit.DB.ModelHermiteSpline, Autodesk.Revit.DB.ModelNurbSpline"

def almost_eq(line, mc):
	line2 = mc.Location.Curve
	xyz1 = line.Evaluate(0.5, True)
	if not line2.IsBound:
		xyz2 = line2.Center
		try: xyz1 = line.Center
		except: pass
	else:
		xyz2 = line2.Evaluate(0.5, True)
	if xyz1.DistanceTo(xyz2) <= 0.0001:
		return True
	else:
		return False

def clean1(l1):
	for i in xrange(len(l1) ):
		l1[i] = [x for x in l1[i] if x != None]
	return l1

def getSketch(el1):
	try:
		sk1 = doc.GetElement(ElementId(el1.Id.IntegerValue - 1) )
	except:
		sk1 = None
	if not getModel and sk1 is not None and sk1.GetType().ToString() == 'Autodesk.Revit.DB.Sketch':
		profile = sk1.Profile
	else:
		deleted = doc.Delete(el1.Id)

		
		profile, mc = CurveArrArray(), []
		for d in deleted:
			test_el = doc.GetElement(d)
			el_type = test_el.GetType().ToString()
			if el_type == "Autodesk.Revit.DB.Sketch":
				profile = test_el.Profile
				if not getModel:
					break
			elif getModel and el_type in accepted_mc :
				mc.append(test_el)

	ordered_mc = [ [None] * i.Size for i in profile] if getModel else []
	curves = [ [None] * i.Size for i in profile]
	for i in xrange(profile.Size):
		for j in xrange(profile[i].Size):
			curves[i][j] = profile[i][j].ToProtoType()
			if getModel:
				for k in xrange(len(mc)):
					if almost_eq(profile[i][j], mc[k]):
						ordered_mc[i][j] = mc[k].ToDSType(True)
						del mc[k]
						break
						
	return curves, clean1(ordered_mc), profile, sk1, sk1.GetType()

TransactionManager.Instance.EnsureInTransaction(doc)
result = map(getSketch, elements)
TransactionManager.Instance.TransactionTaskDone()
#OUT = output1([r[0] for r in result]), output1([r[1] for r in result])
OUT = result
# ----------------------------------------
code_block = CodeBlock(a=python_script_2) { a[0][3]; }
parameters_2 = Element.Parameters(code_block)
setParameterByName = Element.SetParameterByName()  # unwired: element, parameterName, value
code_block_2 = CodeBlock { "Name"; }
getParameterValueByName = Element.GetParameterValueByName(element=code_block, parameterName=code_block_2)
python_script_3 = Python(IN[0]=select_model_element_2)  # unwired: IN[1], IN[2]; same code as python_script

# group: Select Filled Regions
select_model_elements = DSModelElementsSelection()  # 5 picked in the model

get_all_line_styles = Python()
# ---------- get_all_line_styles.python (24 lines) ----------
import clr
# import Document Manager
clr.AddReference("RevitServices")
import RevitServices 
from RevitServices.Persistence import DocumentManager
from RevitServices.Transactions import TransactionManager
doc = DocumentManager.Instance.CurrentDBDocument
uidoc = DocumentManager.Instance.CurrentUIDocument
clr.AddReference("RevitNodes")
import Revit
clr.ImportExtensions(Revit.Elements)
clr.ImportExtensions(Revit.GeometryConversion)
clr.AddReference("RevitAPI")
from Autodesk.Revit.DB import *


coll = FilteredElementCollector(doc).OfClass(GraphicsStyle).ToElementIds()

elements = []

for c in coll:
	elements.append(doc.GetElement(c))

OUT = elements
# ----------------------------------------
name = Element.Name(get_all_line_styles)

# group: Select Line Style
code_block_3 = CodeBlock { "<Invisible lines>"; }

firstIndexOf = List.FirstIndexOf(list=name, item=code_block_3)
getItemAtIndex = List.GetItemAtIndex(list=get_all_line_styles, index=firstIndexOf)
python_script_4 = Python(IN[0]=select_model_elements, IN[1]=getItemAtIndex)
# ---------- python_script_4.python (33 lines) ----------
import clr
clr.AddReference('ProtoGeometry')
from Autodesk.DesignScript.Geometry import *

# Import DocumentManager and TransactionManager
clr.AddReference("RevitServices")
import RevitServices
from RevitServices.Persistence import DocumentManager
from RevitServices.Transactions import TransactionManager

# Import RevitAPI
clr.AddReference("RevitAPI")
import Autodesk
from Autodesk.Revit.DB import *

doc = DocumentManager.Instance.CurrentDBDocument
uiapp = DocumentManager.Instance.CurrentUIApplication
app = uiapp.Application


region = UnwrapElement(IN[0])

ids = UnwrapElement(IN[1])

TransactionManager.Instance.EnsureInTransaction(doc)

for r in region:
	FilledRegion.SetLineStyleId(r, ids.Id)

TransactionManager.Instance.TransactionTaskDone()

#Assign your outputs to the OUT variable
OUT = region
# ----------------------------------------
categories = Categories("Lines")
all_elements_of_category = ElementsOfCategory(categories)
parameters_3 = Element.Parameters(all_elements_of_category)
family_types = FamilyTypes("Angled Step:Angled Step")
