# Dynamo graph CheckTypeParameters.dyn (Dynamo 0.8.2.2392)

code_block = CodeBlock { a[0]; }
count = List.Count(code_block, lacing=Longest)
code_block_2 = CodeBlock(a=count) { 1..a; }
boolean = BoolSelector(true)
python_script = Python(IN[0]=code_block, IN[1]=code_block_2, IN[2]=boolean)
# ---------- python_script.python (53 lines) ----------
import clr
# Import RevitAPI
clr.AddReference("RevitAPI")
from Autodesk.Revit.DB import *
clr.AddReference("RevitAPIUI")
from Autodesk.Revit.UI import TaskDialog
# Import DocumentManager and TransactionManager
clr.AddReference("RevitServices")
from RevitServices.Persistence import DocumentManager
from RevitServices.Transactions import TransactionManager
# Import ToProtoType, ToRevitType geometry conversion extension methods
clr.AddReference("RevitNodes")
import Revit
clr.ImportExtensions(Revit.Elements)
clr.ImportExtensions(Revit.GeometryConversion)
from System.Collections.Generic import *
import System

doc = DocumentManager.Instance.CurrentDBDocument
uiapp = DocumentManager.Instance.CurrentUIApplication
app = uiapp.Application



elements = UnwrapElement(IN[0])

locCode = IN[1]


model_cat = []
error = []

count = 0
total = 0

if IN[2] == True:
	TransactionManager.Instance.EnsureInTransaction(doc)
	for i in range(0,len(elements)):
		for j in range(0,len(elements[i])):
			total +=1
			try:
				locationCode = elements[i][j].get_Parameter("Mark")
				locationCode.Set(str(locCode[i][j]))
				count +=1
			except:
				error.append(elements[i][j])
		
		TransactionManager.Instance.TransactionTaskDone()
		OUT  = str(count)+"/"+str(total)+" modified", error
else:
	OUT = "Set true to run"

#OUT = model_cat, [c.Name for c in model_cat], elements
# ----------------------------------------

# group: Element Types not modified
code_block_3 = CodeBlock(a=python_script) { a[1]; }
name = Element.Name(code_block_3)

python_script_2 = Python()
# ---------- python_script_2.python (65 lines) ----------
import clr
# Import RevitAPI
clr.AddReference("RevitAPI")
from Autodesk.Revit.DB import *
clr.AddReference("RevitAPIUI")
from Autodesk.Revit.UI import TaskDialog
# Import DocumentManager and TransactionManager
clr.AddReference("RevitServices")
from RevitServices.Persistence import DocumentManager
from RevitServices.Transactions import TransactionManager
# Import ToProtoType, ToRevitType geometry conversion extension methods
clr.AddReference("RevitNodes")
import Revit
clr.ImportExtensions(Revit.Elements)
clr.ImportExtensions(Revit.GeometryConversion)
from System.Collections.Generic import *
import System

doc = DocumentManager.Instance.CurrentDBDocument
uiapp = DocumentManager.Instance.CurrentUIApplication
app = uiapp.Application




collector = FilteredElementCollector( doc ).WhereElementIsNotElementType()

cat = []

for c in collector:
	if (None != c.Category and c.Category.HasMaterialQuantities):
		cat.append(c)

typeIds = [c.GetTypeId() for c in cat]


unique = list(set(typeIds))

indexes = []

f = lambda my_list, value:filter(lambda x: my_list[x] == value, range(len(my_list)))

for x in unique:
	indexes.append(f(typeIds, x))

result = []

for i in indexes:
	sub = []
	result.append(sub)
	for j in i:
		sub.append(cat[j])

check = []

for r in result:
	for i in r:
		try:
			eid = i.GetTypeId()
			e = doc.GetElement(eid)
			check.append(e.get_Parameter("Discipline").AsString())
		except:
			check.append("error")

OUT = result, check
# ----------------------------------------
code_block_4 = CodeBlock(a=python_script_2) { a[1]; }
