# Dynamo graph clash.dyn (Dynamo 1.3.2.2480)

select_model_elements = DSModelElementsSelection()  # 3 picked in the model
geometry = Element.Geometry(select_model_elements)

# group: FROM LINK MODEL
select_model_element = DSModelElementSelection()  # 1 picked in the model
categories = Categories("CableTray")
ofCategory = Revit.LinkElement.OfCategory(select_model_element, categories)

intersectsElement = Revit.Element.IntersectsElement(select_model_elements, ofCategory)
location = Revit.LinkElement.Location(intersectsElement)
flatten = Flatten(location)
intersectAll = Geometry.IntersectAll(geometry=geometry, others=flatten)
intersect = Geometry.Intersect(geometry=geometry@L1, other=location, lacing=Longest)
flatten_2 = Flatten(intersect@L3)
code_block = CodeBlock { 0.5; }
pointAtParameter = Curve.PointAtParameter(curve=flatten_2, param=code_block)
location_2 = StructuralFraming.Location(select_model_elements)
code_block_2 = CodeBlock { "z Offset Value"; }
getParameterValueByName = Element.GetParameterValueByName(element=select_model_elements, parameterName=code_block_2)
translate = Geometry.Translate(geometry=location_2, zTranslation=getParameterValueByName)
endPoints = Geometry.Curves.EndPoints(translate)
create = List.Create(endPoints.out0, endPoints.out1)
boundingBox = Element.BoundingBox(select_model_elements)
boundingBox_2 = Revit.LinkElement.BoundingBox(intersectsElement)
intersection = BoundingBox.Intersection(boundingBox, boundingBox_2)
toCuboid = BoundingBox.ToCuboid(intersection)
centroid = Solid.Centroid(toCuboid)

# group: Distance from Ends
distanceTo = Geometry.DistanceTo(geometry=create, other=centroid, lacing=Longest)

code_block_3 = CodeBlock { 1000; }
gt = distanceTo > code_block_3

# group: Distance from Top Flange
distanceTo_2 = Geometry.DistanceTo(geometry=translate, other=centroid, lacing=Longest)

code_block_4 = CodeBlock { "Type"; }
getParameterValueByName_2 = Element.GetParameterValueByName(element=select_model_elements, parameterName=code_block_4)
code_block_5 = CodeBlock { "d"; }
getParameterValueByName_3 = Element.GetParameterValueByName(element=getParameterValueByName_2, parameterName=code_block_5)
code_block_6 = CodeBlock(beamDepth=getParameterValueByName_3) { (beamDepth-100)/2; }
gt_2 = distanceTo_2 > code_block_6
code_block_7 = CodeBlock { -1; }
mul = getParameterValueByName_3 * code_block_7
translate_2 = Geometry.Translate(geometry=translate, zTranslation=mul)

# group: Distance from Bottom Flange
distanceTo_3 = Geometry.DistanceTo(geometry=translate_2, other=centroid, lacing=Longest)

code_block_8 = CodeBlock(beamDepth=getParameterValueByName_3) { (beamDepth-100)/2; }
gt_3 = distanceTo_3 > code_block_8
python_script = Python(IN[0]=gt, IN[1]=gt_2, IN[2]=gt_3)
# ---------- python_script.python (16 lines) ----------
import clr
clr.AddReference('ProtoGeometry')
from Autodesk.DesignScript.Geometry import *
#The inputs to this node will be stored as a list in the IN variables.
list1 = IN[0]
list2 = IN[1]
list3 = IN[2]



for i in range(0,len(list1)):
	list1[i].append(list2[i])
	list1[i].append(list3[i])

#Assign your output to the OUT variable.
OUT = list1
# ----------------------------------------
countFalse = CountFalse(python_script)
family_types = FamilyTypes("Arup_OpeningAdjustableCube:OpeningAdjustableCube")
properties = Custom[BoundingBox.Properties](boundingBox=intersection)  # Retrieves the centroid, width, depth and height of a given bounding box

# group: Level
levels = Levels("LEVEL 1")

byPointAndLevel = FamilyInstance.ByPointAndLevel(familyType=family_types, point=properties.Centroid, level=levels)
code_block_9 = CodeBlock { "z"; }

# group: TOLERANCES
code_block_10 = CodeBlock { 100; }
code_block_11 = CodeBlock { 100; }

code_block_12 = CodeBlock(Depths=properties.Height, Tolerance=code_block_10) { Depths+Tolerance; }
setParameterByName = Element.SetParameterByName(element=byPointAndLevel, parameterName=code_block_9, value=code_block_12, lacing=Longest)
code_block_13 = CodeBlock { "y"; }
code_block_14 = CodeBlock(Depths=properties.Depth, Tolerance=code_block_11) { Depths+Tolerance; }
setParameterByName_2 = Element.SetParameterByName(element=byPointAndLevel, parameterName=code_block_13, value=code_block_14, lacing=Longest)
code_block_15 = CodeBlock { "x"; }
setParameterByName_3 = Element.SetParameterByName(element=byPointAndLevel, parameterName=code_block_15, value=properties.Width, lacing=Longest)
