# Dynamo graph clash04.dyn (Dynamo 1.3.2.2480)

select_model_elements = DSModelElementsSelection()  # 1 picked in the model
select_model_elements_2 = DSModelElementsSelection()  # 1 picked in the model
code_block = CodeBlock(a=select_model_elements, b=select_model_elements_2) { {a,b}; }
select_model_elements_3 = DSModelElementsSelection()  # 3 picked in the model
select_model_elements_4 = DSModelElementsSelection()  # 2 picked in the model
code_block_2 = CodeBlock(a=select_model_elements_3, b=select_model_elements_4) { {a,b}; }
python_script = Python(IN[0]=code_block, IN[1]=code_block_2)
# ---------- python_script.python (172 lines) ----------
import clr
clr.AddReference("ProtoGeometry")
from Autodesk.DesignScript.Geometry import *

LineBestFit = Line.ByBestFitThroughPoints

# Import RevitAPI
clr.AddReference("RevitAPI")
from Autodesk.Revit.DB import *
clr.AddReference("RevitAPIUI")
from Autodesk.Revit.UI import TaskDialog
# Import DocumentManager and TransactionManager
clr.AddReference("RevitServices")
from RevitServices.Persistence import DocumentManager
from RevitServices.Transactions import TransactionManager
# Import ToProtoType, ToRevitType geometry conversion extension methods
clr.AddReference("RevitNodes")
import Revit
clr.ImportExtensions(Revit.GeometryConversion)

import math

doc = DocumentManager.Instance.CurrentDBDocument
uiapp = DocumentManager.Instance.CurrentUIApplication
app = uiapp.Application


beam = UnwrapElement(IN[0])
duct = UnwrapElement(IN[1])
dynamoBeams = IN[0]


def GetElemType(e):
	try:
		elemType = doc.GetElement(e.GetTypeId())
		return elemType
	except:
		pass
		return None

def GetParamValue(eType, pName):
	paramValue = None
	for i in eType.Parameters:
		if i.Definition.Name == pName:
			paramValue = i.AsValueString()
			break
		else:
			continue
	return paramValue


def GetParam(element, name):
	p = element.get_Parameter(name)	
	if p.StorageType == StorageType.String:
		return p.AsString()
	elif p.StorageType == StorageType.ElementId:
		elem = doc.GetElement(p.AsElementId())
		return elem
	elif p.StorageType == StorageType.Double:
		ProjectUnits = p.DisplayUnitType
		newval = UnitUtils.ConvertFromInternalUnits(p.AsDouble(),ProjectUnits)
		return newval
	else:
		return p.AsInteger()

def GetEndPoints(beam):
	return [beam.Location.Curve.GetEndPoint(0).ToPoint(), beam.Location.Curve.GetEndPoint(1).ToPoint()]


def PointXYDistance(Pt0, Pt1):
	distance = math.pow((math.pow((Pt0.X-Pt1.X),2) + math.pow((Pt0.Y-Pt1.Y),2)),0.5)
	return round(distance,0)

def beamRealCurve(element):
	vertex = element.Geometry()[0].Vertices
	pGeom = []
	for v in vertex:
		pGeom.append(v.PointGeometry)
	crv = LineBestFit(pGeom)	
	return crv
	

values = []


for i in range(0,len(beam)):
	val = []
	values.append(val)
	for j in range(0,len(duct[i])):
		# BEAM PARAMETERS
		
		zOffset = GetParam(beam[i], BuiltInParameter.Z_OFFSET_VALUE) # NEGATIVE VALUE!
		
		beamZTop = GetEndPoints(beam[i])[0].Z + zOffset
		
		#beamEndPoint = GetEndPoints(beam)[1] NOT ACCURATE!
		
		beamStPoint = beamRealCurve(dynamoBeams[i]).StartPoint
		beamEndPoint = beamRealCurve(dynamoBeams[i]).EndPoint
		
		#length = round(GetParam(beam, BuiltInParameter.INSTANCE_LENGTH_PARAM),0) NOT NEEDED ANYMORE!
		
		#cutLength = round(GetParam(beam, BuiltInParameter.STRUCTURAL_FRAME_CUT_LENGTH),0) NOT NEEDED ANYMORE!
		
		#remainLength = length - cutLength NOT NEEDED ANYMORE!
		
		beamDepth = int(GetParamValue(GetElemType(beam[i]), "d"))
		
		
		# DUCT PARAMETERS
		
		ductWidth = int(GetParamValue(duct[i][j], "y"))
		
		
		
		ductHeight = int(GetParamValue(duct[i][j], "z"))
		
		
		
		ductCentroid = duct[i][j].Location.Point.ToPoint()
		
		
		# CHECKS 
		
		# 1. BEAM START POINT TO OPENING EDGE DISTANCE
		
		beamStOpeningEdgeDist = PointXYDistance(ductCentroid, beamStPoint) - ductWidth/2
		
		val.append(beamStOpeningEdgeDist)
		
		beamEndOpeningEdgeDist = PointXYDistance(ductCentroid, beamEndPoint) - ductWidth/2
		
		val.append(beamEndOpeningEdgeDist)
		
		# 2. DISTANCE FROM FLANGES
		
		distTopFlange = round(beamZTop - ductCentroid.Z - ductHeight/2,0)
		
		val.append(distTopFlange)
		
		distBotFlange = round(beamDepth - ductHeight - distTopFlange,0)
		
		val.append(distBotFlange)
		
		val.append(ductWidth)
		
		val.append(ductHeight)
		
		# 3. CHECKS
		"""
		checkA = beamStOpeningEdgeDist > (2 * beamDepth or ductWidth)
		
		checkB = beamEndOpeningEdgeDist > (2 * beamDepth or ductWidth)
		
		checkC = distTopFlange > (0.25 * beamDepth)
		
		checkD = distBotFlange > (0.25 * beamDepth)
		
		checkE = ductWidth < beamDepth
		
		checkF = ductHeight < (0.5 * beamDepth)
"""

#names = ["beamStOpeningEdgeDist", "beamEndOpeningEdgeDist", "distTopFlange", "distBotFlange", "ductWidth", "ductHeight"]
#values = [beamStOpeningEdgeDist, beamEndOpeningEdgeDist, distTopFlange, distBotFlange, ductWidth, ductHeight]
#checks = [checkA, checkB, checkC, checkD, checkE, checkF]

#dict = [names, values, checks]

#OUT = map(list, zip(*dict))

OUT = values
# ----------------------------------------
code_block_3 = CodeBlock { 6; }
chop = List.Chop(list=python_script, lengths=code_block_3, lacing=Longest)
python_script_2 = Python()  # unwired: IN[0], IN[1]
# ---------- python_script_2.python (88 lines) ----------
# Copyright(c) 2015, Konrad K Sobon
# @arch_laboratory, http://archi-lab.net

import clr
clr.AddReference('ProtoGeometry')
from Autodesk.DesignScript.Geometry import *

# Import DocumentManager and TransactionManager
clr.AddReference("RevitServices")
import RevitServices
from RevitServices.Persistence import DocumentManager
doc = DocumentManager.Instance.CurrentDBDocument

# Import RevitAPI
clr.AddReference("RevitAPI")
import Autodesk
from Autodesk.Revit.DB import *

import sys
pyt_path = r'C:\Program Files (x86)\IronPython 2.7\Lib'
sys.path.append(pyt_path)

#The inputs to this node will be stored as a list in the IN variable.
dataEnteringNode = IN

paramNames = IN[1]

if isinstance(IN[0], list):
	elements = []
	for i in IN[0]:
		elements.append(UnwrapElement(i))
else:
	elements = UnwrapElement(IN[0])

def ProcessList(_func, _list):
	return map( lambda x: ProcessList(_func, x) if type(x)==list else _func(x), _list )

def ProcessListArg(_func, _list, _arg):
    return map( lambda x: ProcessListArg(_func, x, _arg) if type(x)==list else _func(x, _arg), _list )

def GetElemType(e):
	doc = DocumentManager.Instance.CurrentDBDocument
	try:
		elemType = doc.GetElement(e.GetTypeId())
		return elemType
	except:
		pass
		return None

def GetParamValue(eType, pName):
	paramValue = None
	for i in eType.Parameters:
		if i.Definition.Name == pName:
			paramValue = i.AsString()
			break
		else:
			continue
	return paramValue

try:
	errorReport = None
	paramValues = []
	if isinstance(elements, list):
		elemTypes = ProcessList(GetElemType, elements)
		if isinstance(paramNames, list):
			for i in paramNames:
				paramValues.append(ProcessListArg(GetParamValue, elemTypes, i))
			paramValues = map(list, zip(*paramValues))
		else:
			paramValues = ProcessListArg(GetParamValue, elemTypes, paramNames)
	else:
		elemTypes = [GetElemType(elements)]
		if isinstance(paramNames, list):
			for i in paramNames:
				paramValues.append(ProcessListArg(GetParamValue, elemTypes, i))
			paramValues = map(list, zip(*paramValues))
		else:
			paramValues = ProcessListArg(GetParamValue, elemTypes, paramNames)
except:
	# if error accurs anywhere in the process catch it
	import traceback
	errorReport = traceback.format_exc()	

#Assign your output to the OUT variable
if errorReport == None:
	OUT = paramValues
else:
	OUT = errorReport
# ----------------------------------------
duct_clash_check = Custom[Duct Clash Check](Beams=code_block@L1, Ducts=code_block_2@L1, lacing=Longest)  # Check Clash
