# Dynamo graph Split Columns.dyn (Dynamo 0.8.2.2392)

code_block = CodeBlock { "Top Level"; }
levels = Levels("F03 - THIRD FLOOR")
setParameterByName = Element.SetParameterByName(parameterName=code_block, value=levels)
# note: Column
element_types = ElementTypes("Level")
all_elements_of_type = ElementsOfType(element_types)
# note: Floors
select_model_elements = DSModelElementsSelection()  # 4 picked in the model
code_block_2 = CodeBlock { "Level"; }
getParameterValueByName = Element.GetParameterValueByName(element=select_model_elements, parameterName=code_block_2)
setIntersection = SetIntersection(all_elements_of_type, getParameterValueByName)
count = Count(setIntersection)
python_script = Python()
# ---------- python_script.python (47 lines) ----------
#Copyright(c) 2016, Dimitar Venkov
# @5devene, dimitar.ven@gmail.com

import clr

clr.AddReference("RevitServices")
import RevitServices
from RevitServices.Persistence import DocumentManager
from RevitServices.Transactions import TransactionManager
doc = DocumentManager.Instance.CurrentDBDocument

clr.AddReference("RevitNodes")
import Revit
clr.ImportExtensions(Revit.Elements)
clr.ImportExtensions(Revit.GeometryConversion)

clr.AddReference("RevitAPI")
from Autodesk.Revit.DB import *

clr.AddReference("System")
from System.Collections.Generic import List as cList

elements = UnwrapElement(IN[0])

level = UnwrapElement(IN[1])

"""
for el,v in zip(elements,level):
	el.SetParameterByName("Top Level", v)
"""
LevelPara = []

#toplvl = elements[0].get_Parameter(BuiltInParameter.FAMILY_INSTANCE_TOP_LEVEL_PARAM)
TransactionManager.Instance.EnsureInTransaction(doc)


toplvl = elements.get_Parameter("Top Level")

toplvl.Set(level.Id)

TransactionManager.Instance.TransactionTaskDone()
"""
for el,v in zip(elements,level):
	param = el.get_Parameter("Top Level")
	LevelPara.append(param.Set(v))
"""
OUT = toplvl
# ----------------------------------------
select_model_element = DSModelElementSelection()
class_ = Custom[Object.Class](obj=levels)  # Gets the input object's class name. Can process lists.
select_model_elements_2 = DSModelElementsSelection()  # 1 picked in the model
code_block_3 = CodeBlock { Vector.ByCoordinates(0,0,0); }
# note: Number of Columns
code_block_4 = CodeBlock { 3; }
cycle = List.Cycle(list=code_block_3, amount=code_block_4)
python_script_2 = Python(IN[0]=select_model_elements_2, IN[1]=cycle)
# ---------- python_script_2.python (61 lines) ----------
#Copyright(c) 2016, Dimitar Venkov
# @5devene, dimitar.ven@gmail.com

import clr

clr.AddReference("RevitServices")
import RevitServices
from RevitServices.Persistence import DocumentManager
from RevitServices.Transactions import TransactionManager
doc = DocumentManager.Instance.CurrentDBDocument

clr.AddReference("RevitNodes")
import Revit
clr.ImportExtensions(Revit.Elements)
clr.ImportExtensions(Revit.GeometryConversion)

clr.AddReference("RevitAPI")
from Autodesk.Revit.DB import *

clr.AddReference("System")
from System.Collections.Generic import List as cList

def tolist(obj1):
	if hasattr(obj1,"__iter__"): return obj1
	else: return [obj1]

def output1(l1):
	if len(l1) == 1: return l1[0]
	else: return l1

elements = UnwrapElement(tolist(IN[0]))
vecs = tolist(IN[1])

oldId = []

for i in xrange(len(elements)):
	try: oldId.append(elements[i].Id)
	except: pass
	
oldId1 = cList[ElementId](oldId)

transforms = []
for i in xrange(len(vecs)):
	try: transforms.append(vecs[i].ToXyz(True))
	except: pass
	
def CopyEls(oldId1, transforms):
	out1 = []
	for i in xrange(len(transforms)):
		try:
			newId = ElementTransformUtils.CopyElements(doc, oldId1, transforms[i])
			if len(newId) == 1 :
				out1.append(doc.GetElement(newId[0]).ToDSType(False))
			else:
				[out1.append(doc.GetElement(newId[i]).ToDSType(False)) for i in xrange(len(newId))]
		except: out1.append([])
	return out1
	
TransactionManager.Instance.EnsureInTransaction(doc)
OUT = output1(CopyEls(oldId1, transforms))
TransactionManager.Instance.TransactionTaskDone()
# ----------------------------------------
flatten = Flatten(python_script_2)
levels_2 = Levels("F02 - SECOND FLOOR")
levels_3 = Levels("F03 - THIRD FLOOR")
levels_4 = Levels("F04 - ROOF FLOOR")
# note: Top Level
create = List.Create(levels_2, levels_3, levels_4)
levels_5 = Levels("L01 - FIRST FLOOR")
# note: Base Level
create_2 = List.Create(levels_5, levels_2, levels_3)
python_script_3 = Python(IN[0]=flatten, IN[1]=create, IN[2]=create_2)
# ---------- python_script_3.python (46 lines) ----------
#Copyright(c) 2016, Dimitar Venkov
# @5devene, dimitar.ven@gmail.com

import clr

clr.AddReference("RevitServices")
import RevitServices
from RevitServices.Persistence import DocumentManager
from RevitServices.Transactions import TransactionManager
doc = DocumentManager.Instance.CurrentDBDocument

clr.AddReference("RevitNodes")
import Revit
clr.ImportExtensions(Revit.Elements)
clr.ImportExtensions(Revit.GeometryConversion)

clr.AddReference("RevitAPI")
from Autodesk.Revit.DB import *

clr.AddReference("System")
from System.Collections.Generic import List as cList

elements = UnwrapElement(IN[0])

level = UnwrapElement(IN[1])

bslevel = UnwrapElement(IN[2])

LevelPara = []

#toplvl = elements[0].get_Parameter(BuiltInParameter.FAMILY_INSTANCE_TOP_LEVEL_PARAM)
TransactionManager.Instance.EnsureInTransaction(doc)

for el,v,z in zip(elements,level,bslevel):
	toplvl = el.get_Parameter("Top Level")
	toplvl.Set(v.Id)
	baselvl = el.get_Parameter("Base Level")
	baselvl.Set(z.Id)

TransactionManager.Instance.TransactionTaskDone()
"""
for el,v in zip(elements,level):
	param = el.get_Parameter("Top Level")
	LevelPara.append(param.Set(v))
"""
OUT = toplvl
# ----------------------------------------
levels_6 = Levels("B01 - TOP SLAB.")
select_model_element_2 = DSModelElementSelection()  # 1 picked in the model
create_3 = List.Create(select_model_element_2, python_script_2)
