# Dynamo graph Split Columns08.dyn (Dynamo 1.3.0.875)

categories = Categories("StructuralColumns")
all_elements_of_category = ElementsOfCategory(categories)
categories_2 = Categories("Floors")
all_elements_of_category_2 = ElementsOfCategory(categories_2)
code_block = CodeBlock { 0.05; }
getSurroundingElements = Custom[Tool.GetSurroundingElements](Element=all_elements_of_category, ElementCheck=all_elements_of_category_2, Tolerance=code_block)  # Get Surrounding Elements by Categories, group them as List. Tolerance distance available.
deconstruct = List.Deconstruct(list=getSurroundingElements, lacing=Longest)
count = Count(deconstruct.first)
code_block_2 = CodeBlock { "Thickness"; }
getParameterValueByName = Element.GetParameterValueByName(element=deconstruct.rest, parameterName=code_block_2)
code_block_3 = CodeBlock(a=deconstruct.rest) { a; }
reverse = List.Reverse(code_block_3, lacing=Longest)
code_block_4 = CodeBlock(a=deconstruct.first) { a; }
# note: Floors
boundingBox = Geometry.BoundingBox(deconstruct.rest, lacing=Longest)
maxPoint = BoundingBox.MaxPoint(boundingBox)
Z = Point.Z(maxPoint)
sortByKey = List.SortByKey(list=maxPoint, keys=Z, lacing=Longest)
# note: L3-L2-L1
reverse_2 = List.Reverse(sortByKey.sorted_keys, lacing=Longest)
python_script = Python(IN[0]=reverse_2)
# ---------- python_script.python (17 lines) ----------
import clr
clr.AddReference('ProtoGeometry')
from Autodesk.DesignScript.Geometry import *
#The inputs to this node will be stored as a list in the IN variables.
list = IN[0]
newList = []

for i in range(0,len(list)):
	nL = []
	newList.append(nL)
	if len(list[i])>1:
		for j in range(0,len(list[i])-1):
			nL.append(list[i][j]-list[i][j+1])
	else:
		nL.append(list[i][0])
#Assign your output to the OUT variable.
OUT = newList
# ----------------------------------------
# note: Columns
boundingBox_2 = Geometry.BoundingBox(deconstruct.first, lacing=Longest)
maxPoint_2 = BoundingBox.MaxPoint(boundingBox_2)
minPoint = BoundingBox.MinPoint(boundingBox_2)
# note: Column Length
code_block_5 = CodeBlock(maxPoint_2, minPoint) { TopPt.Z-BottomPt.Z; }
python_script_2 = Python(IN[0]=reverse_2, IN[1]=code_block_5)
# ---------- python_script_2.python (10 lines) ----------
lista = IN[0]
colLength = IN[1]

for i in range(0,len(lista)):
	if len(lista[i])>1:
		lista[i] = lista[i][:len(lista[i])-1]
	else:
		lista[i] = [colLength[i]]

OUT = lista
# ----------------------------------------
code_block_6 = CodeBlock(minPoint) { Pt.Z; }
sub = python_script_2 - code_block_6  # lacing=Longest
div = python_script / sub  # lacing=Longest
code_block_7 = CodeBlock(a=div) { 1-a; }
python_script_3 = Python(IN[0]=code_block_4, IN[1]=code_block_7)
# ---------- python_script_3.python (37 lines) ----------
import clr
 
clr.AddReference("RevitServices")
import RevitServices
from RevitServices.Persistence import DocumentManager
from RevitServices.Transactions import TransactionManager
doc =  DocumentManager.Instance.CurrentDBDocument

clr.AddReference("RevitNodes")
import Revit
clr.ImportExtensions(Revit.Elements)
clr.ImportExtensions(Revit.GeometryConversion)

clr.AddReference("RevitAPI")
from Autodesk.Revit.DB import *

# Import System Collections...
import System
from System.Collections.Generic import *

 

col = UnwrapElement(IN[0])
splitValues = IN[1]


outList = []

for j in range(0,len(col)):
	oL = []
	outList.append(oL)
	for i in range(0,len(splitValues[j])):
		TransactionManager.Instance.EnsureInTransaction(doc)
		oL.append(doc.GetElement(col[j].Split(splitValues[j][i])))
		TransactionManager.Instance.TransactionTaskDone()

OUT = outList
# ----------------------------------------
addItemToEnd = List.AddItemToEnd(item=code_block_4, list=python_script_3, lacing=Longest)
