# Dynamo graph moveColumn.dyn (Dynamo 1.3.1.1736)

select_model_element = DSModelElementSelection()
ungroup = Custom[Group.Ungroup](group=select_model_element)  # Ungroups a group and returns the ungrouped elements.
name = Element.Name(ungroup)
code_block = CodeBlock { "UK"; }
contains = String.Contains(str=name, searchFor=code_block)
filterByBoolMask = List.FilterByBoolMask(list=ungroup, mask=contains)
flatten = Flatten(filterByBoolMask.in)
code_block_2 = CodeBlock(a=flatten) { a[0]; }
getLocation = Element.GetLocation(filterByBoolMask.in)
flatten_2 = Flatten(getLocation)
code_block_3 = CodeBlock { Autodesk.Point.ByCoordinates(5000,5000,0); }
byTwoPoints = Vector.ByTwoPoints(start=flatten_2, end=code_block_3)
code_block_4 = CodeBlock(a=byTwoPoints) { a.X; a.Y; a.Z; }
byCoordinates = Point.ByCoordinates(x=code_block_4.out0, y=code_block_4.out1, z=code_block_4.out2)
code_block_5 = CodeBlock(a=byCoordinates) { a[0]; }
python_script = Python(IN[0]=code_block_2, IN[1]=code_block_5)
# ---------- python_script.python (34 lines) ----------
import clr
clr.AddReference("ProtoGeometry")
from Autodesk.DesignScript.Geometry import *
# Import RevitAPI
clr.AddReference("RevitAPI")
from Autodesk.Revit.DB import *
clr.AddReference("RevitAPIUI")
from Autodesk.Revit.UI import TaskDialog
# Import DocumentManager and TransactionManager
clr.AddReference("RevitServices")
from RevitServices.Persistence import DocumentManager
from RevitServices.Transactions import TransactionManager
# Import ToProtoType, ToRevitType geometry conversion extension methods
clr.AddReference("RevitNodes")
import Revit
clr.ImportExtensions(Revit.GeometryConversion)

doc = DocumentManager.Instance.CurrentDBDocument
uiapp = DocumentManager.Instance.CurrentUIApplication
app = uiapp.Application

column = UnwrapElement(IN[0])

newPlace = UnwrapElement(IN[1]).ToXyz()

# "Start" the transaction
TransactionManager.Instance.EnsureInTransaction(doc)

ElementTransformUtils.MoveElement(doc, column.Id, newPlace);

# "End" the transaction
TransactionManager.Instance.TransactionTaskDone()

OUT = column
# ----------------------------------------
create = List.Create(python_script, ungroup)
restOfItems = List.RestOfItems(create)
flatten_3 = Flatten(restOfItems)
name_2 = Element.Name(select_model_element)
fromElements = Custom[Group.FromElements](elements=flatten_3, groupName=name_2)  # Creates a group from a list of Revit elements
