# Dynamo graph Beams from DWG layers REV01.dyn (Dynamo 1.2.3.592)

# group: IN THIS GRAPH YOU FEED A LIST OF STRUCTURAL FRAMING TYPES

# group: IN THIS GRAPH YOU TYPE THE BEAM NAME AND THE PYTHON SCRIPT SELECTS THAT BEAM TYPE FROM ALL THE BEAM IN THE PROJECT

# group: SELECT IMPORTED DWG
select_model_element = DSModelElementSelection()

code_block = CodeBlock { {"PURLINS"}; }
boolean = BoolSelector(false)

# group: SELECT LEVEL
levels = Levels("00")

# group: FROM biMORPH PACKAGE
python_script = Python(IN[0]=select_model_element, IN[1]=code_block, IN[2]=boolean, IN[3]=levels)
# ---------- python_script.python (136 lines) ----------
#Copyright 2016. All rights reserved. Bimorph Consultancy LTD, 5 St Johns Lane, London EC1M 4BH www.bimorph.co.uk
#Written by Thomas Mahon @Thomas__Mahon info@bimorph.co.uk package: bimorphNodes
#GitHub: https://github.com/ThomasMahon/bimorphNodes/

import clr

# Import DocumentManager and TransactionManager
clr.AddReference("RevitServices")
import RevitServices
from RevitServices.Persistence import DocumentManager
from RevitServices.Transactions import TransactionManager
from System.Collections.Generic import *

clr.AddReference("RevitNodes")
import Revit
# Import ToProtoType, ToRevitType geometry conversion extension methods
clr.ImportExtensions(Revit.GeometryConversion)

# Import RevitAPI
clr.AddReference("RevitAPI")
import Autodesk
from Autodesk.Revit.DB import *

doc = DocumentManager.Instance.CurrentDBDocument
uiapp = DocumentManager.Instance.CurrentUIApplication
app = uiapp.Application

importDWG = UnwrapElement(IN[0])
nameOfLayersToImport = IN[1]
revitModelLines = IN[2]

if nameOfLayersToImport == None or nameOfLayersToImport == []: 
	catSub = importDWG.Category.SubCategories
	enum = catSub.GetEnumerator()
	
	nameOfLayersToImport = []
	while enum.MoveNext():
		layerName = enum.Current.Name
		nameOfLayersToImport.Add( layerName )

if isinstance(nameOfLayersToImport, list):
	layerList = nameOfLayersToImport
else:
	layerList = [nameOfLayersToImport]

def storageDictionary(crvListDict, eleGraphicStyleName, e):
	if eleGraphicStyleName in crvListDict.keys(): 
		crvListDict[eleGraphicStyleName].append( e )
	else:
		crvListDict[eleGraphicStyleName] = []
		crvListDict[eleGraphicStyleName].append( e )
		
	
def curveConversion (crv, revitModelLines, crvObject, refPlane):
	if revitModelLines == True:
		crv.Add( doc.Create.NewModelCurve( crvObject, refPlane) )
	else:
		crv.Add( crvObject.ToProtoType() )
	
TransactionManager.Instance.EnsureInTransaction(doc)

geomEnum = importDWG.Geometry[ Options() ].GetEnumerator()

crvListDict = dict()
failedFilter = []
while geomEnum.MoveNext(): 
	instGeom = geomEnum.Current.GetInstanceGeometry()
	
	instGeomEnum = instGeom.GetEnumerator()
	while instGeomEnum.MoveNext():
		e = instGeomEnum.Current
		try:
			graphicStyleId = e.GraphicsStyleId
					
			eleGraphicStyle = doc.GetElement(graphicStyleId)
			eleGraphicStyleName = eleGraphicStyle.GraphicsStyleCategory.Name
			
			
			if eleGraphicStyleName in layerList: 
				storageDictionary(crvListDict, eleGraphicStyleName, e)

		except:
			try: 
				vol = e.Volume
				
				if vol == 0.0: 
					edgesList = e.Edges
					edgesEnum = edgesList.GetEnumerator()

					while edgesEnum.MoveNext():
						edge = edgesEnum.Current
						eleGraphicStyle = doc.GetElement(edge.GraphicsStyleId)
						eleGraphicStyleName = eleGraphicStyle.GraphicsStyleCategory.Name
						
						if eleGraphicStyleName in layerList:
							storageDictionary(crvListDict, eleGraphicStyleName, edge.AsCurve() )
							
			except: 
				failedFilter.Add(e)

if "2015" in app.VersionName:
	levelParam = "Base Level"
else:
	levelParam = BuiltInParameter.IMPORT_BASE_LEVEL

levelId = UnwrapElement(IN[3]).Id

pln = SketchPlane.Create(doc, levelId )
	
crvList = [ crv for crv in crvListDict.values() ] 

failedConversion = []
modelLines =  []
for subList in crvList: 
	crv = []
	for i in subList: 
		try:
			crvType = i.GetType()
			if crvType != Autodesk.Revit.DB.PolyLine:
				curveConversion(crv, revitModelLines, i, pln)
			else: 
				pt = i.GetCoordinates()
				count = i.NumberOfCoordinates
					
				for j in range(count-1): 
					ln = Line.CreateBound(pt[j], pt[j+1])
					curveConversion(crv, revitModelLines, ln, pln)
						
		except: 
			failedConversion.Add( i )
				
	modelLines.Add(crv)

TransactionManager.Instance.TransactionTaskDone()

OUT = modelLines, crvListDict.keys()
# ----------------------------------------

code_block_2 = CodeBlock(a=python_script) { Flatten(a[0]); }

# group: SELECT LEVEL
levels_2 = Levels()

# group: SELECT COLUMN TYPE
structural_column_types = StructuralColumnTypes()

# group: PLACE COLUMNS
code_block_3 = CodeBlock { Flatten(a[0]); }  # unwired: a
columnByCurve = StructuralFraming.ColumnByCurve(curve=code_block_3, level=levels_2, structuralColumnType=structural_column_types)

# group: SELECT LAYER
code_block_4 = CodeBlock { a[8]; }  # unwired: a

boolean_2 = BoolSelector(false)

# group: FROM biMORPH PACKAGE
python_script_2 = Python(IN[0]=select_model_element, IN[1]=code_block_4, IN[2]=boolean_2, IN[3]=levels_2)  # same code as python_script

# group: PLACE BEAMS
beamByCurve = StructuralFraming.BeamByCurve(lacing=Longest)  # unwired: curve, level, structuralFramingType
code_block_5 = CodeBlock { "Comments"; }

code_block_6 = CodeBlock(A=python_script) { A[0]; }

# group: TYPE BEAM SIZE
string = StringInput("UKC203x203x71")

# group: RETRIEVE THE SELECTED BEAM
# note: Collect all the beams in Revit
python_script_3 = Python()  # unwired: IN[0]
# ---------- python_script_3.python (22 lines) ----------
import clr
clr.AddReference('ProtoGeometry')
from Autodesk.DesignScript.Geometry import *

# Import RevitAPI
clr.AddReference("RevitAPI")
import Autodesk
from Autodesk.Revit.DB import *

# Import RevitAPI
clr.AddReference("RevitServices")
import RevitServices
from RevitServices.Persistence import DocumentManager

#The inputs to this node will be stored as a list in the IN variables.
doc = DocumentManager.Instance.CurrentDBDocument
cat = doc.Settings.Categories

collector = FilteredElementCollector(doc).OfCategory(BuiltInCategory.OST_StructuralFraming)

#Assign your output to the OUT variable.
OUT = [i for i in collector]
# ----------------------------------------
name = Family.Name(python_script_3)
bv_remove_nulls = Custom[bv Remove Nulls](List=name)  # forked from Lunchbox
code_block_7 = CodeBlock { 1; }
contains = String.Contains(str=bv_remove_nulls, searchFor=string, ignoreCase=code_block_7)
filterByBoolMask = List.FilterByBoolMask(list=python_script_3, mask=contains)

combine = List.Combine(beamByCurve, code_block_6, levels, filterByBoolMask.in)
code_block_8 = CodeBlock(a=combine) { Flatten(a); }
code_block_9 = CodeBlock(A=python_script) { A[1]; }
count = Count(combine, lacing=Longest)
cycle = List.Cycle(list=code_block_9, amount=count, lacing=Longest)
code_block_10 = CodeBlock(a=cycle) { Flatten(a); }

# group (continued): PLACE BEAMS
setParameterByName = Element.SetParameterByName(element=code_block_8, parameterName=code_block_5, value=code_block_10)

# group: SELECT IMPORTED DWG
select_model_element_2 = DSModelElementSelection()

code_block_11 = CodeBlock { {"PURLINS", "BACK EDGE", "FRONT EDGE BEAM"}; }
boolean_3 = BoolSelector(false)

# group: SELECT LEVEL
levels_3 = Levels()

# group: FROM biMORPH PACKAGE
python_script_4 = Python(IN[1]=code_block_11, IN[2]=boolean_3, IN[3]=levels_3)  # unwired: IN[0]; same code as python_script

code_block_12 = CodeBlock(a=python_script_4) { Flatten(a[0]); }

# group: PLACE BEAMS
beamByCurve_2 = StructuralFraming.BeamByCurve(lacing=Longest)  # unwired: curve, level, structuralFramingType
code_block_13 = CodeBlock { "Comments"; }

code_block_14 = CodeBlock(A=python_script_4) { A[0]; }
create = List.Create(levels_3, levels_3, levels_3)
structural_framing_types = StructuralFramingTypes("UKC203x203x71")
structural_framing_types_2 = StructuralFramingTypes("UKC203x203x71")
structural_framing_types_3 = StructuralFramingTypes("UKC203x203x71")
create_2 = List.Create(structural_framing_types, structural_framing_types_2, structural_framing_types_3)
combine_2 = List.Combine(beamByCurve_2, code_block_14, create, create_2)
code_block_15 = CodeBlock(a=combine_2) { Flatten(a); }
code_block_16 = CodeBlock(A=python_script_4) { A[1]; }
count_2 = Count(combine_2, lacing=Longest)
cycle_2 = List.Cycle(list=code_block_16, amount=count_2, lacing=Longest)
code_block_17 = CodeBlock(a=cycle_2) { Flatten(a); }

# group (continued): PLACE BEAMS
setParameterByName_2 = Element.SetParameterByName(element=code_block_15, parameterName=code_block_13, value=code_block_17)

curvesFromCADLayers = Custom[CurvesFromCADLayers]()  # Extract curves from a CAD link or import by layer name. Curves are organised into layer sublists. To create Revit Model Lines set the createModelLines input to true This node is also optimised to convert curve types that typically fail when using Revit.Elements.Element.Curves or Full Explode; unwired: importInstance
