# Dynamo graph Beams from DWG layers v08 REV01.dyn (Dynamo 0.8.2.2392)

# group: SELECT IMPORTED DWG
select_model_element = DSModelElementSelection()

code_block = CodeBlock { {"PURLINS"}; }
boolean = BoolSelector(false)

# group: SELECT LEVEL
levels = Levels("R02 BUS ROOF (UPPER)")

# group: FROM biMORPH PACKAGE
python_script = Python(IN[0]=select_model_element, IN[1]=code_block, IN[2]=boolean, IN[3]=levels)
# ---------- python_script.python (136 lines) ----------
#Copyright 2016. All rights reserved. Bimorph Consultancy LTD, 5 St Johns Lane, London EC1M 4BH www.bimorph.co.uk
#Written by Thomas Mahon @Thomas__Mahon info@bimorph.co.uk package: bimorphNodes
#GitHub: https://github.com/ThomasMahon/bimorphNodes/

import clr

# Import DocumentManager and TransactionManager
clr.AddReference("RevitServices")
import RevitServices
from RevitServices.Persistence import DocumentManager
from RevitServices.Transactions import TransactionManager
from System.Collections.Generic import *

clr.AddReference("RevitNodes")
import Revit
# Import ToProtoType, ToRevitType geometry conversion extension methods
clr.ImportExtensions(Revit.GeometryConversion)

# Import RevitAPI
clr.AddReference("RevitAPI")
import Autodesk
from Autodesk.Revit.DB import *

doc = DocumentManager.Instance.CurrentDBDocument
uiapp = DocumentManager.Instance.CurrentUIApplication
app = uiapp.Application

importDWG = UnwrapElement(IN[0])
nameOfLayersToImport = IN[1]
revitModelLines = IN[2]

if nameOfLayersToImport == None or nameOfLayersToImport == []: 
	catSub = importDWG.Category.SubCategories
	enum = catSub.GetEnumerator()
	
	nameOfLayersToImport = []
	while enum.MoveNext():
		layerName = enum.Current.Name
		nameOfLayersToImport.Add( layerName )

if isinstance(nameOfLayersToImport, list):
	layerList = nameOfLayersToImport
else:
	layerList = [nameOfLayersToImport]

def storageDictionary(crvListDict, eleGraphicStyleName, e):
	if eleGraphicStyleName in crvListDict.keys(): 
		crvListDict[eleGraphicStyleName].append( e )
	else:
		crvListDict[eleGraphicStyleName] = []
		crvListDict[eleGraphicStyleName].append( e )
		
	
def curveConversion (crv, revitModelLines, crvObject, refPlane):
	if revitModelLines == True:
		crv.Add( doc.Create.NewModelCurve( crvObject, refPlane) )
	else:
		crv.Add( crvObject.ToProtoType() )
	
TransactionManager.Instance.EnsureInTransaction(doc)

geomEnum = importDWG.Geometry[ Options() ].GetEnumerator()

crvListDict = dict()
failedFilter = []
while geomEnum.MoveNext(): 
	instGeom = geomEnum.Current.GetInstanceGeometry()
	
	instGeomEnum = instGeom.GetEnumerator()
	while instGeomEnum.MoveNext():
		e = instGeomEnum.Current
		try:
			graphicStyleId = e.GraphicsStyleId
					
			eleGraphicStyle = doc.GetElement(graphicStyleId)
			eleGraphicStyleName = eleGraphicStyle.GraphicsStyleCategory.Name
			
			
			if eleGraphicStyleName in layerList: 
				storageDictionary(crvListDict, eleGraphicStyleName, e)

		except:
			try: 
				vol = e.Volume
				
				if vol == 0.0: 
					edgesList = e.Edges
					edgesEnum = edgesList.GetEnumerator()

					while edgesEnum.MoveNext():
						edge = edgesEnum.Current
						eleGraphicStyle = doc.GetElement(edge.GraphicsStyleId)
						eleGraphicStyleName = eleGraphicStyle.GraphicsStyleCategory.Name
						
						if eleGraphicStyleName in layerList:
							storageDictionary(crvListDict, eleGraphicStyleName, edge.AsCurve() )
							
			except: 
				failedFilter.Add(e)

if "2015" in app.VersionName:
	levelParam = "Base Level"
else:
	levelParam = BuiltInParameter.IMPORT_BASE_LEVEL

levelId = UnwrapElement(IN[3]).Id

pln = SketchPlane.Create(doc, levelId )
	
crvList = [ crv for crv in crvListDict.values() ] 

failedConversion = []
modelLines =  []
for subList in crvList: 
	crv = []
	for i in subList: 
		try:
			crvType = i.GetType()
			if crvType != Autodesk.Revit.DB.PolyLine:
				curveConversion(crv, revitModelLines, i, pln)
			else: 
				pt = i.GetCoordinates()
				count = i.NumberOfCoordinates
					
				for j in range(count-1): 
					ln = Line.CreateBound(pt[j], pt[j+1])
					curveConversion(crv, revitModelLines, ln, pln)
						
		except: 
			failedConversion.Add( i )
				
	modelLines.Add(crv)

TransactionManager.Instance.TransactionTaskDone()

OUT = modelLines, crvListDict.keys()
# ----------------------------------------

code_block_2 = CodeBlock(a=python_script) { Flatten(a[0]); }

# group: TYPE BEAM SIZE
string = StringInput("UKC203x203x71")

# group: RETRIEVE THE SELECTED BEAM
python_script_2 = Python()
# ---------- python_script_2.python (22 lines) ----------
import clr
clr.AddReference('ProtoGeometry')
from Autodesk.DesignScript.Geometry import *

# Import RevitAPI
clr.AddReference("RevitAPI")
import Autodesk
from Autodesk.Revit.DB import *

# Import RevitAPI
clr.AddReference("RevitServices")
import RevitServices
from RevitServices.Persistence import DocumentManager

#The inputs to this node will be stored as a list in the IN variables.
doc = DocumentManager.Instance.CurrentDBDocument
cat = doc.Settings.Categories

collector = FilteredElementCollector(doc).OfCategory(BuiltInCategory.OST_StructuralFraming)

#Assign your output to the OUT variable.
OUT = [i for i in collector]
# ----------------------------------------
name = Family.Name(python_script_2)
bv_remove_nulls = Custom[bv Remove Nulls](List=name)  # forked from Lunchbox
code_block_3 = CodeBlock { 1; }
contains = String.Contains(str=bv_remove_nulls, searchFor=string, ignoreCase=code_block_3)
filterByBoolMask = List.FilterByBoolMask(list=python_script_2, mask=contains)

# group: SELECT LEVEL
levels_2 = Levels("G00 - ENTRANCE")

# group: SELECT COLUMN TYPE
structural_column_types = StructuralColumnTypes("1000 x 1000mm")

# group: PLACE COLUMNS
code_block_4 = CodeBlock { Flatten(a[0]); }
columnByCurve = StructuralFraming.ColumnByCurve(code_block_4, levels_2, structural_column_types)

# group: SELECT LAYER
code_block_5 = CodeBlock { a[8]; }

boolean_2 = BoolSelector(false)

# group: FROM biMORPH PACKAGE
python_script_3 = Python(IN[0]=select_model_element, IN[1]=code_block_5, IN[2]=boolean_2, IN[3]=levels_2)  # same code as python_script

# group: PLACE BEAMS
beamByCurve = StructuralFraming.BeamByCurve(lacing=Longest)
code_block_6 = CodeBlock { "Comments"; }

code_block_7 = CodeBlock(A=python_script) { A[0]; }
structural_framing_types = StructuralFramingTypes("UKC254x254x167")
combine = List.Combine(beamByCurve, code_block_7, levels, structural_framing_types)
code_block_8 = CodeBlock(a=combine) { Flatten(a); }
code_block_9 = CodeBlock(A=python_script) { A[1]; }
count = Count(combine, lacing=Longest)
cycle = List.Cycle(list=code_block_9, amount=count, lacing=Longest)
code_block_10 = CodeBlock(a=cycle) { Flatten(a); }

# group (continued): PLACE BEAMS
setParameterByName = Element.SetParameterByName(element=code_block_8, parameterName=code_block_6, value=code_block_10)

# group: TYPE BEAM SIZE
string_2 = StringInput("UKC203x203x71")

code_block_11 = CodeBlock { {"TOP CHORD","BOTTOM CHORD", "CANTILEVER"}; }
boolean_3 = BoolSelector(false)

# group: SELECT LEVEL
levels_3 = Levels("R02 BUS ROOF (UPPER)")

# group: FROM biMORPH PACKAGE
python_script_4 = Python(IN[1]=code_block_11, IN[2]=boolean_3, IN[3]=levels_3)  # same code as python_script

code_block_12 = CodeBlock(a=python_script_4) { Flatten(a[0]); }

# group: PLACE BEAMS
beamByCurve_2 = StructuralFraming.BeamByCurve(lacing=Longest)
code_block_13 = CodeBlock { "Comments"; }

code_block_14 = CodeBlock(A=python_script_4) { A[0]; }
create = List.Create(levels_3, levels_3, levels_3)
structural_framing_types_2 = StructuralFramingTypes("UKC254x254x167")
structural_framing_types_3 = StructuralFramingTypes("UKC254x254x107")
structural_framing_types_4 = StructuralFramingTypes("UKC254x254x107")
create_2 = List.Create(structural_framing_types_2, structural_framing_types_3, structural_framing_types_4)
combine_2 = List.Combine(beamByCurve_2, code_block_14, create, create_2)
code_block_15 = CodeBlock(a=combine_2) { Flatten(a); }
code_block_16 = CodeBlock(A=python_script_4) { A[1]; }
count_2 = Count(combine_2, lacing=Longest)
cycle_2 = List.Cycle(list=code_block_16, amount=count_2, lacing=Longest)
code_block_17 = CodeBlock(a=cycle_2) { Flatten(a); }

# group (continued): PLACE BEAMS
setParameterByName_2 = Element.SetParameterByName(element=code_block_15, parameterName=code_block_13, value=code_block_17)

# group: SELECT IMPORTED DWG
select_model_element_2 = DSModelElementSelection()

code_block_18 = CodeBlock { {"PURLINS", "BACK EDGE", "FRONT EDGE BEAM"}; }
boolean_4 = BoolSelector(false)

# group: SELECT LEVEL
levels_4 = Levels("R02 BUS ROOF (UPPER)")

# group: FROM biMORPH PACKAGE
python_script_5 = Python(IN[1]=code_block_18, IN[2]=boolean_4, IN[3]=levels_4)  # same code as python_script

code_block_19 = CodeBlock(a=python_script_5) { Flatten(a[0]); }

# group: PLACE BEAMS
beamByCurve_3 = StructuralFraming.BeamByCurve(lacing=Longest)
code_block_20 = CodeBlock { "Comments"; }

code_block_21 = CodeBlock(A=python_script_5) { A[0]; }
create_3 = List.Create(levels_4, levels_4, levels_4)
structural_framing_types_5 = StructuralFramingTypes("UKC203x203x71")
structural_framing_types_6 = StructuralFramingTypes("UKC203x203x71")
structural_framing_types_7 = StructuralFramingTypes("UKC203x203x71")
create_4 = List.Create(structural_framing_types_5, structural_framing_types_6, structural_framing_types_7)
combine_3 = List.Combine(beamByCurve_3, code_block_21, create_3, create_4)
code_block_22 = CodeBlock(a=combine_3) { Flatten(a); }
code_block_23 = CodeBlock(A=python_script_5) { A[1]; }
count_3 = Count(combine_3, lacing=Longest)
cycle_3 = List.Cycle(list=code_block_23, amount=count_3, lacing=Longest)
code_block_24 = CodeBlock(a=cycle_3) { Flatten(a); }

# group (continued): PLACE BEAMS
setParameterByName_3 = Element.SetParameterByName(element=code_block_22, parameterName=code_block_20, value=code_block_24)

# group: SELECT IMPORTED DWG
select_model_element_3 = DSModelElementSelection()
