# Dynamo graph Beams from DWG layers v08.dyn (Dynamo 0.8.2.2392)

# group: SELECT LEVEL
levels = Levels("G00 - ENTRANCE")

# group: SELECT COLUMN TYPE
structural_column_types = StructuralColumnTypes("1000 x 1000mm")

# group: PLACE COLUMNS
code_block = CodeBlock { Flatten(a[0]); }
columnByCurve = StructuralFraming.ColumnByCurve(code_block, levels, structural_column_types)

# group: SELECT IMPORTED DWG
select_model_element = DSModelElementSelection()  # 1 picked in the model

# group: SELECT LAYER
code_block_2 = CodeBlock { a[8]; }

boolean = BoolSelector(false)

# group: FROM biMORPH PACKAGE
python_script = Python(IN[0]=select_model_element, IN[1]=code_block_2, IN[2]=boolean, IN[3]=levels)
# ---------- python_script.python (136 lines) ----------
#Copyright 2016. All rights reserved. Bimorph Consultancy LTD, 5 St Johns Lane, London EC1M 4BH www.bimorph.co.uk
#Written by Thomas Mahon @Thomas__Mahon info@bimorph.co.uk package: bimorphNodes
#GitHub: https://github.com/ThomasMahon/bimorphNodes/

import clr

# Import DocumentManager and TransactionManager
clr.AddReference("RevitServices")
import RevitServices
from RevitServices.Persistence import DocumentManager
from RevitServices.Transactions import TransactionManager
from System.Collections.Generic import *

clr.AddReference("RevitNodes")
import Revit
# Import ToProtoType, ToRevitType geometry conversion extension methods
clr.ImportExtensions(Revit.GeometryConversion)

# Import RevitAPI
clr.AddReference("RevitAPI")
import Autodesk
from Autodesk.Revit.DB import *

doc = DocumentManager.Instance.CurrentDBDocument
uiapp = DocumentManager.Instance.CurrentUIApplication
app = uiapp.Application

importDWG = UnwrapElement(IN[0])
nameOfLayersToImport = IN[1]
revitModelLines = IN[2]

if nameOfLayersToImport == None or nameOfLayersToImport == []: 
	catSub = importDWG.Category.SubCategories
	enum = catSub.GetEnumerator()
	
	nameOfLayersToImport = []
	while enum.MoveNext():
		layerName = enum.Current.Name
		nameOfLayersToImport.Add( layerName )

if isinstance(nameOfLayersToImport, list):
	layerList = nameOfLayersToImport
else:
	layerList = [nameOfLayersToImport]

def storageDictionary(crvListDict, eleGraphicStyleName, e):
	if eleGraphicStyleName in crvListDict.keys(): 
		crvListDict[eleGraphicStyleName].append( e )
	else:
		crvListDict[eleGraphicStyleName] = []
		crvListDict[eleGraphicStyleName].append( e )
		
	
def curveConversion (crv, revitModelLines, crvObject, refPlane):
	if revitModelLines == True:
		crv.Add( doc.Create.NewModelCurve( crvObject, refPlane) )
	else:
		crv.Add( crvObject.ToProtoType() )
	
TransactionManager.Instance.EnsureInTransaction(doc)

geomEnum = importDWG.Geometry[ Options() ].GetEnumerator()

crvListDict = dict()
failedFilter = []
while geomEnum.MoveNext(): 
	instGeom = geomEnum.Current.GetInstanceGeometry()
	
	instGeomEnum = instGeom.GetEnumerator()
	while instGeomEnum.MoveNext():
		e = instGeomEnum.Current
		try:
			graphicStyleId = e.GraphicsStyleId
					
			eleGraphicStyle = doc.GetElement(graphicStyleId)
			eleGraphicStyleName = eleGraphicStyle.GraphicsStyleCategory.Name
			
			
			if eleGraphicStyleName in layerList: 
				storageDictionary(crvListDict, eleGraphicStyleName, e)

		except:
			try: 
				vol = e.Volume
				
				if vol == 0.0: 
					edgesList = e.Edges
					edgesEnum = edgesList.GetEnumerator()

					while edgesEnum.MoveNext():
						edge = edgesEnum.Current
						eleGraphicStyle = doc.GetElement(edge.GraphicsStyleId)
						eleGraphicStyleName = eleGraphicStyle.GraphicsStyleCategory.Name
						
						if eleGraphicStyleName in layerList:
							storageDictionary(crvListDict, eleGraphicStyleName, edge.AsCurve() )
							
			except: 
				failedFilter.Add(e)

if "2015" in app.VersionName:
	levelParam = "Base Level"
else:
	levelParam = BuiltInParameter.IMPORT_BASE_LEVEL

levelId = UnwrapElement(IN[3]).Id

pln = SketchPlane.Create(doc, levelId )
	
crvList = [ crv for crv in crvListDict.values() ] 

failedConversion = []
modelLines =  []
for subList in crvList: 
	crv = []
	for i in subList: 
		try:
			crvType = i.GetType()
			if crvType != Autodesk.Revit.DB.PolyLine:
				curveConversion(crv, revitModelLines, i, pln)
			else: 
				pt = i.GetCoordinates()
				count = i.NumberOfCoordinates
					
				for j in range(count-1): 
					ln = Line.CreateBound(pt[j], pt[j+1])
					curveConversion(crv, revitModelLines, ln, pln)
						
		except: 
			failedConversion.Add( i )
				
	modelLines.Add(crv)

TransactionManager.Instance.TransactionTaskDone()

OUT = modelLines, crvListDict.keys()
# ----------------------------------------

# group: SELECT LAYER
python_script_2 = Python(IN[0]=select_model_element)
# ---------- python_script_2.python (22 lines) ----------
#Copyright 2016. All rights reserved. Bimorph Consultancy LTD, 5 St Johns Lane, London EC1M 4BH www.bimorph.co.uk
#Written by Thomas Mahon @Thomas__Mahon info@bimorph.co.uk package: bimorphNodes
#GitHub: https://github.com/ThomasMahon/bimorphNodes/

import clr

# Import RevitAPI
clr.AddReference("RevitAPI")
import Autodesk
from Autodesk.Revit.DB import *

dwgImport = UnwrapElement(IN[0])

catSub = dwgImport.Category.SubCategories
enum = catSub.GetEnumerator()

nameList = []
while enum.MoveNext():
	layerName = enum.Current.Name
	nameList.Add( layerName )
	
OUT  = nameList
# ----------------------------------------
code_block_3 = CodeBlock(a=python_script_2) { a[6]; }

boolean_2 = BoolSelector(false)

# group: SELECT LEVEL
levels_2 = Levels("G00 - ENTRANCE")

# group: FROM biMORPH PACKAGE
python_script_3 = Python(IN[0]=select_model_element, IN[1]=code_block_3, IN[2]=boolean_2, IN[3]=levels_2)  # same code as python_script

code_block_4 = CodeBlock(a=python_script_3) { Flatten(a[0]); }

# group: TYPE BEAM SIZE
string = StringInput("uc203x203x71")

# group: RETRIEVE THE SELECTED BEAM
python_script_4 = Python()
# ---------- python_script_4.python (22 lines) ----------
import clr
clr.AddReference('ProtoGeometry')
from Autodesk.DesignScript.Geometry import *

# Import RevitAPI
clr.AddReference("RevitAPI")
import Autodesk
from Autodesk.Revit.DB import *

# Import RevitAPI
clr.AddReference("RevitServices")
import RevitServices
from RevitServices.Persistence import DocumentManager

#The inputs to this node will be stored as a list in the IN variables.
doc = DocumentManager.Instance.CurrentDBDocument
cat = doc.Settings.Categories

collector = FilteredElementCollector(doc).OfCategory(BuiltInCategory.OST_StructuralFraming)

#Assign your output to the OUT variable.
OUT = [i for i in collector]
# ----------------------------------------
name = Family.Name(python_script_4)
bv_remove_nulls = Custom[bv Remove Nulls](List=name)  # forked from Lunchbox
code_block_5 = CodeBlock { 1; }
contains = String.Contains(str=bv_remove_nulls, searchFor=string, ignoreCase=code_block_5)
filterByBoolMask = List.FilterByBoolMask(list=python_script_4, mask=contains)

# group: PLACE BEAMS
beamByCurve = StructuralFraming.BeamByCurve(code_block_4, levels_2, filterByBoolMask.in, lacing=Longest)
code_block_6 = CodeBlock { "Comments"; }
setParameterByName = Element.SetParameterByName(element=beamByCurve, parameterName=code_block_6, value=code_block_3)
