# Dynamo graph DWG on views.dyn (Dynamo 0.8.2.2392)

element_types = ElementTypes("AnalysisDisplayLegend")
element_types_2 = ElementTypes("ImportInstance")
all_elements_of_type = ElementsOfType(element_types_2)
watch = Watch(all_elements_of_type)
name = Element.Name(watch)
getParameterValueByName = Element.GetParameterValueByName()
parameters = Element.Parameters(watch)
watch_2 = Custom[Watch+](input=parameters)  # This node that serializes the input information and presents it in a resizable text window.
file_path = Filename("C:\Users\giovanni.brogioli\Documents\DWG on Views.xlsx")
code_block = CodeBlock { "Sheet1"; }
code_block_2 = CodeBlock { 0; }
boolean = BoolSelector(true)
writeToFile = Excel.WriteToFile(filePath=file_path, sheetName=code_block, startRow=code_block_2, startCol=code_block_2, data=parameters, overWrite=boolean)
transpose = List.Transpose()
