# Dynamo graph Automatic Dimension v8 01.dyn (Dynamo 0.8.2.2392)

select_model_elements = DSModelElementsSelection()  # 1 picked in the model
python_script = Python(IN[0]=select_model_elements)
# ---------- python_script.python (55 lines) ----------
import clr
clr.AddReference('RevitAPI')
from Autodesk.Revit.DB import *

clr.AddReference("RevitNodes")
import Revit
clr.ImportExtensions(Revit.Elements)
clr.ImportExtensions(Revit.GeometryConversion)

clr.AddReference("RevitServices")
import RevitServices
from RevitServices.Persistence import DocumentManager
from RevitServices.Transactions import TransactionManager

doc = DocumentManager.Instance.CurrentDBDocument

if isinstance(IN[0], list):
	lines = []
	for i in IN[0]:
		lines.append(UnwrapElement(i))
else:
	lines = [UnwrapElement(IN[0])]


crvs = []

for line in lines:
	crvs.append(line.GeometryCurve)
	

#grids = UnwrapElement(IN[1])

"""gridRef = ReferenceArray()
opt = Options()
opt.ComputeReferences = True
opt.IncludeNonVisibleObjects = True
opt.View = doc.ActiveView
for grid in grids:
	for obj in grid.get_Geometry(opt):
		if isinstance(obj, Line):
			gline = obj
			gridRef.Append(gline.Reference)"""

TransactionManager.Instance.EnsureInTransaction(doc)


for crv in crvs:
	ref = ReferenceArray()
	ref.Append(crv.GetEndPointReference(0))
	ref.Append(crv.GetEndPointReference(1))
	dim = doc.Create.NewDimension(doc.ActiveView, crv, ref)

TransactionManager.Instance.TransactionTaskDone()

OUT = dim
# ----------------------------------------

# group: DIM. GRIDLINES
select_model_elements_2 = DSModelElementsSelection()

curve = Grid.Curve(select_model_elements_2)
startPoint = Curve.StartPoint(curve)
firstItem = List.FirstItem(startPoint)
lastItem = List.LastItem(startPoint)
byStartPointEndPoint = Line.ByStartPointEndPoint(startPoint=firstItem, endPoint=lastItem)
code_block = CodeBlock { 500; }
offset = Curve.Offset(curve=byStartPointEndPoint, distance=code_block)
python_script_2 = Python(IN[0]=offset, IN[1]=select_model_elements_2)
# ---------- python_script_2.python (37 lines) ----------
import clr
clr.AddReference('RevitAPI')
from Autodesk.Revit.DB import *

clr.AddReference("RevitNodes")
import Revit
clr.ImportExtensions(Revit.Elements)
clr.ImportExtensions(Revit.GeometryConversion)

clr.AddReference("RevitServices")
import RevitServices
from RevitServices.Persistence import DocumentManager
from RevitServices.Transactions import TransactionManager

doc = DocumentManager.Instance.CurrentDBDocument

line = IN[0].ToRevitType()
grids = UnwrapElement(IN[1])

gridRef = ReferenceArray()
opt = Options()
opt.ComputeReferences = True
opt.IncludeNonVisibleObjects = True
opt.View = doc.ActiveView
for grid in grids:
	for obj in grid.get_Geometry(opt):
		if isinstance(obj, Line):
			gline = obj
			gridRef.Append(gline.Reference)

TransactionManager.Instance.EnsureInTransaction(doc)

dim = doc.Create.NewDimension(doc.ActiveView, line, gridRef)

TransactionManager.Instance.TransactionTaskDone()

OUT = dim
# ----------------------------------------

# group: DIM. LINES w/ OFFSET
select_model_element = DSModelElementSelection()

curves = Element.Curves(select_model_element)
code_block_2 = CodeBlock { 500; }
offset_2 = Curve.Offset(curve=curves, distance=code_block_2)
python_script_3 = Python(IN[0]=select_model_element, IN[1]=offset_2)
# ---------- python_script_3.python (71 lines) ----------
import clr
clr.AddReference('RevitAPI')
from Autodesk.Revit.DB import *

clr.AddReference("RevitNodes")
import Revit
clr.ImportExtensions(Revit.Elements)
clr.ImportExtensions(Revit.GeometryConversion)

clr.AddReference("RevitServices")
import RevitServices
from RevitServices.Persistence import DocumentManager
from RevitServices.Transactions import TransactionManager

doc = DocumentManager.Instance.CurrentDBDocument

if isinstance(IN[0], list):
	lines = []
	for i in IN[0]:
		lines.append(UnwrapElement(i))
else:
	lines = [UnwrapElement(IN[0])]


crvs = []

for line in lines:
	crvs.append(line.GeometryCurve)




if isinstance(IN[1], list):
	linea = []
	for i in IN[1]:
		linea.append(UnwrapElement(i).ToRevitType())
else:
	linea = [UnwrapElement(IN[1]).ToRevitType()]
"""
refln = []

for ln in linea:
	refln.append(ln.ToRevitType())
"""	


#grids = UnwrapElement(IN[1])

"""gridRef = ReferenceArray()
opt = Options()
opt.ComputeReferences = True
opt.IncludeNonVisibleObjects = True
opt.View = doc.ActiveView
for grid in grids:
	for obj in grid.get_Geometry(opt):
		if isinstance(obj, Line):
			gline = obj
			gridRef.Append(gline.Reference)"""

TransactionManager.Instance.EnsureInTransaction(doc)


for crv in crvs:
	ref = ReferenceArray()
	ref.Append(crv.GetEndPointReference(0))
	ref.Append(crv.GetEndPointReference(1))
	dim = doc.Create.NewDimension(doc.ActiveView, linea[0], ref)

TransactionManager.Instance.TransactionTaskDone()

OUT = linea
# ----------------------------------------

# group: DIM. LINES
select_model_elements_3 = DSModelElementsSelection()

watch = Watch(select_model_elements_3)

# group: DIM. MULTIPLE LINES W/ OFFSET
select_model_elements_4 = DSModelElementsSelection()

select_model_elements_5 = DSModelElementsSelection()  # 5 picked in the model
geometry = Element.Geometry(select_model_elements_5)
code_block_3 = CodeBlock(a=geometry) { Flatten(a); }
explode = Geometry.Explode(code_block_3)
code_block_4 = CodeBlock { 1; }
getItemAtIndex = List.GetItemAtIndex(list=explode, index=code_block_4, lacing=Longest)
edges = Topology.Edges(getItemAtIndex)
curveGeometry = Edge.CurveGeometry(edges)
length = Curve.Length(curveGeometry)
code_block_5 = CodeBlock(a=length) { a==3000; }
filterByBoolMask = List.FilterByBoolMask(list=curveGeometry, mask=code_block_5)
python_script_4 = Python(IN[0]=select_model_elements_5, IN[1]=filterByBoolMask.in)
# ---------- python_script_4.python (79 lines) ----------
import clr
clr.AddReference('RevitAPI')
from Autodesk.Revit.DB import *

clr.AddReference("RevitNodes")
import Revit
clr.ImportExtensions(Revit.Elements)
clr.ImportExtensions(Revit.GeometryConversion)

clr.AddReference("RevitServices")
import RevitServices
from RevitServices.Persistence import DocumentManager
from RevitServices.Transactions import TransactionManager

doc = DocumentManager.Instance.CurrentDBDocument

if isinstance(IN[0], list):
	lines = []
	for i in IN[0]:
		lines.append(UnwrapElement(i))
else:
	lines = [UnwrapElement(IN[0])]


crvs = []

for line in lines:
	crvs.append(line.GeometryCurve)


if isinstance(IN[1], list):
	linea = []
	for i in IN[1]:
		linea.append(UnwrapElement(i).ToRevitType())
else:
	linea = [UnwrapElement(IN[1]).ToRevitType()]
"""
refln = []

for ln in linea:
	refln.append(ln.ToRevitType())
"""	


#grids = UnwrapElement(IN[1])

"""gridRef = ReferenceArray()
opt = Options()
opt.ComputeReferences = True
opt.IncludeNonVisibleObjects = True
opt.View = doc.ActiveView
for grid in grids:
	for obj in grid.get_Geometry(opt):
		if isinstance(obj, Line):
			gline = obj
			gridRef.Append(gline.Reference)"""

TransactionManager.Instance.EnsureInTransaction(doc)
"""

for crv in crvs:
	ref = ReferenceArray()
	ref.Append(crv.GetEndPointReference(0))
	ref.Append(crv.GetEndPointReference(1))
	for i in range (0,len(linea)):
		dim = doc.Create.NewDimension(doc.ActiveView, linea[i], ref)
"""

for i in range (0,len(linea)):
	ref = ReferenceArray()
	ref.Append(crvs[i].GetEndPointReference(0))
	ref.Append(crvs[i].GetEndPointReference(1))
	dim = doc.Create.NewDimension(doc.ActiveView, linea[i], ref)



TransactionManager.Instance.TransactionTaskDone()

OUT = linea
# ----------------------------------------
curves_2 = Element.Curves(code_block_3)
code_block_6 = CodeBlock { 500; }
offset_3 = Curve.Offset(curve=curves_2, distance=code_block_6)
flatten = Flatten(offset_3)
select_model_element_2 = DSModelElementSelection()
select_model_element_3 = DSModelElementSelection()
location = Custom[Element.Location]()  # Returns the location of an element as an XYZ (or if it's line-based the start and end point of the line), along with some booleans to help filtering the results. Use this for some element types (e.g. walls or lines) that do not work with the built-in Get Family Instance Location node.
location_2 = Custom[Element.Location]()
byStartPointEndPoint_2 = Line.ByStartPointEndPoint(startPoint=location.Port_10, endPoint=location_2.Port_10)
byCurve = ModelCurve.ByCurve(byStartPointEndPoint_2)
code_block_7 = CodeBlock { 500; }
offset_4 = Curve.Offset(curve=byStartPointEndPoint_2, distance=code_block_7)
python_script_5 = Python(IN[0]=byCurve, IN[1]=offset_4)  # same code as python_script_4
faces = Topology.Faces()
area = Surface.Area(faces, lacing=Longest)
area_2 = Surface.Area(explode)
