# Dynamo graph Automatic Dimension.dyn (Dynamo 0.8.2.2392)

# group: DIM. LINES
select_model_elements = DSModelElementsSelection()  # 2 picked in the model

python_script = Python(IN[0]=select_model_elements)
# ---------- python_script.python (55 lines) ----------
import clr
clr.AddReference('RevitAPI')
from Autodesk.Revit.DB import *

clr.AddReference("RevitNodes")
import Revit
clr.ImportExtensions(Revit.Elements)
clr.ImportExtensions(Revit.GeometryConversion)

clr.AddReference("RevitServices")
import RevitServices
from RevitServices.Persistence import DocumentManager
from RevitServices.Transactions import TransactionManager

doc = DocumentManager.Instance.CurrentDBDocument

if isinstance(IN[0], list):
	lines = []
	for i in IN[0]:
		lines.append(UnwrapElement(i))
else:
	lines = [UnwrapElement(IN[0])]


crvs = []

for line in lines:
	crvs.append(line.GeometryCurve)
	

#grids = UnwrapElement(IN[1])

"""gridRef = ReferenceArray()
opt = Options()
opt.ComputeReferences = True
opt.IncludeNonVisibleObjects = True
opt.View = doc.ActiveView
for grid in grids:
	for obj in grid.get_Geometry(opt):
		if isinstance(obj, Line):
			gline = obj
			gridRef.Append(gline.Reference)"""

TransactionManager.Instance.EnsureInTransaction(doc)


for crv in crvs:
	ref = ReferenceArray()
	ref.Append(crv.GetEndPointReference(0))
	ref.Append(crv.GetEndPointReference(1))
	dim = doc.Create.NewDimension(doc.ActiveView, crv, ref)

TransactionManager.Instance.TransactionTaskDone()

OUT = dim
# ----------------------------------------

# group: DIM. GRIDLINES
select_model_elements_2 = DSModelElementsSelection()  # 14 picked in the model

curve = Grid.Curve(select_model_elements_2)
startPoint = Curve.StartPoint(curve)
firstItem = List.FirstItem(startPoint)
lastItem = List.LastItem(startPoint)
byStartPointEndPoint = Line.ByStartPointEndPoint(startPoint=firstItem, endPoint=lastItem)
code_block = CodeBlock { 500; }
offset = Curve.Offset(curve=byStartPointEndPoint, distance=code_block)
python_script_2 = Python(IN[0]=offset, IN[1]=select_model_elements_2)
# ---------- python_script_2.python (37 lines) ----------
import clr
clr.AddReference('RevitAPI')
from Autodesk.Revit.DB import *

clr.AddReference("RevitNodes")
import Revit
clr.ImportExtensions(Revit.Elements)
clr.ImportExtensions(Revit.GeometryConversion)

clr.AddReference("RevitServices")
import RevitServices
from RevitServices.Persistence import DocumentManager
from RevitServices.Transactions import TransactionManager

doc = DocumentManager.Instance.CurrentDBDocument

line = IN[0].ToRevitType()
grids = UnwrapElement(IN[1])

gridRef = ReferenceArray()
opt = Options()
opt.ComputeReferences = True
opt.IncludeNonVisibleObjects = True
opt.View = doc.ActiveView
for grid in grids:
	for obj in grid.get_Geometry(opt):
		if isinstance(obj, Line):
			gline = obj
			gridRef.Append(gline.Reference)

TransactionManager.Instance.EnsureInTransaction(doc)

dim = doc.Create.NewDimension(doc.ActiveView, line, gridRef)

TransactionManager.Instance.TransactionTaskDone()

OUT = dim
# ----------------------------------------

# group: DIM. LINES w/ OFFSET
select_model_element = DSModelElementSelection()  # 1 picked in the model

curves = Element.Curves(select_model_element)
code_block_2 = CodeBlock { 500; }
offset_2 = Curve.Offset(curve=curves, distance=code_block_2)
python_script_3 = Python(IN[0]=select_model_element, IN[1]=offset_2)
# ---------- python_script_3.python (71 lines) ----------
import clr
clr.AddReference('RevitAPI')
from Autodesk.Revit.DB import *

clr.AddReference("RevitNodes")
import Revit
clr.ImportExtensions(Revit.Elements)
clr.ImportExtensions(Revit.GeometryConversion)

clr.AddReference("RevitServices")
import RevitServices
from RevitServices.Persistence import DocumentManager
from RevitServices.Transactions import TransactionManager

doc = DocumentManager.Instance.CurrentDBDocument

if isinstance(IN[0], list):
	lines = []
	for i in IN[0]:
		lines.append(UnwrapElement(i))
else:
	lines = [UnwrapElement(IN[0])]


crvs = []

for line in lines:
	crvs.append(line.GeometryCurve)




if isinstance(IN[1], list):
	linea = []
	for i in IN[1]:
		linea.append(UnwrapElement(i).ToRevitType())
else:
	linea = [UnwrapElement(IN[1]).ToRevitType()]
"""
refln = []

for ln in linea:
	refln.append(ln.ToRevitType())
"""	


#grids = UnwrapElement(IN[1])

"""gridRef = ReferenceArray()
opt = Options()
opt.ComputeReferences = True
opt.IncludeNonVisibleObjects = True
opt.View = doc.ActiveView
for grid in grids:
	for obj in grid.get_Geometry(opt):
		if isinstance(obj, Line):
			gline = obj
			gridRef.Append(gline.Reference)"""

TransactionManager.Instance.EnsureInTransaction(doc)


for crv in crvs:
	ref = ReferenceArray()
	ref.Append(crv.GetEndPointReference(0))
	ref.Append(crv.GetEndPointReference(1))
	dim = doc.Create.NewDimension(doc.ActiveView, linea[0], ref)

TransactionManager.Instance.TransactionTaskDone()

OUT = linea
# ----------------------------------------
watch = Watch(select_model_elements)

# group: DIM. MULTIPLE LINES W/ OFFSET
select_model_elements_3 = DSModelElementsSelection()  # 2 picked in the model

curves_2 = Element.Curves(select_model_elements_3)
code_block_3 = CodeBlock { 500; }
offset_3 = Curve.Offset(curve=curves_2, distance=code_block_3)
flatten = Flatten(offset_3)
python_script_4 = Python(IN[0]=select_model_elements_3, IN[1]=flatten)
# ---------- python_script_4.python (79 lines) ----------
import clr
clr.AddReference('RevitAPI')
from Autodesk.Revit.DB import *

clr.AddReference("RevitNodes")
import Revit
clr.ImportExtensions(Revit.Elements)
clr.ImportExtensions(Revit.GeometryConversion)

clr.AddReference("RevitServices")
import RevitServices
from RevitServices.Persistence import DocumentManager
from RevitServices.Transactions import TransactionManager

doc = DocumentManager.Instance.CurrentDBDocument

if isinstance(IN[0], list):
	lines = []
	for i in IN[0]:
		lines.append(UnwrapElement(i))
else:
	lines = [UnwrapElement(IN[0])]


crvs = []

for line in lines:
	crvs.append(line.GeometryCurve)


if isinstance(IN[1], list):
	linea = []
	for i in IN[1]:
		linea.append(UnwrapElement(i).ToRevitType())
else:
	linea = [UnwrapElement(IN[1]).ToRevitType()]
"""
refln = []

for ln in linea:
	refln.append(ln.ToRevitType())
"""	


#grids = UnwrapElement(IN[1])

"""gridRef = ReferenceArray()
opt = Options()
opt.ComputeReferences = True
opt.IncludeNonVisibleObjects = True
opt.View = doc.ActiveView
for grid in grids:
	for obj in grid.get_Geometry(opt):
		if isinstance(obj, Line):
			gline = obj
			gridRef.Append(gline.Reference)"""

TransactionManager.Instance.EnsureInTransaction(doc)
"""

for crv in crvs:
	ref = ReferenceArray()
	ref.Append(crv.GetEndPointReference(0))
	ref.Append(crv.GetEndPointReference(1))
	for i in range (0,len(linea)):
		dim = doc.Create.NewDimension(doc.ActiveView, linea[i], ref)
"""

for i in range (0,len(linea)):
	ref = ReferenceArray()
	ref.Append(crvs[i].GetEndPointReference(0))
	ref.Append(crvs[i].GetEndPointReference(1))
	dim = doc.Create.NewDimension(doc.ActiveView, linea[i], ref)



TransactionManager.Instance.TransactionTaskDone()

OUT = linea
# ----------------------------------------
watch_2 = Watch()
select_model_element_2 = DSModelElementSelection()  # 1 picked in the model
location = Custom[Element.Location](element=select_model_element_2)  # Returns the location of an element as an XYZ (or if it's line-based the start and end point of the line), along with some booleans to help filtering the results. Use this for some element types (e.g. walls or lines) that do not work with the built-in Get Family Instance Location node.
select_model_element_3 = DSModelElementSelection()  # 1 picked in the model
location_2 = Custom[Element.Location](element=select_model_element_3)
byStartPointEndPoint_2 = Line.ByStartPointEndPoint(startPoint=location.points, endPoint=location_2.points)
byCurve = ModelCurve.ByCurve(byStartPointEndPoint_2)
code_block_4 = CodeBlock { 500; }
offset_4 = Curve.Offset(curve=byStartPointEndPoint_2, distance=code_block_4)
python_script_5 = Python(IN[0]=byCurve, IN[1]=offset_4)  # same code as python_script_4
