# Dynamo graph Automatic Dimension04.dyn (Dynamo 1.3.1.1736)

python_script = Python()  # unwired: IN[0]
# ---------- python_script.python (55 lines) ----------
import clr
clr.AddReference('RevitAPI')
from Autodesk.Revit.DB import *

clr.AddReference("RevitNodes")
import Revit
clr.ImportExtensions(Revit.Elements)
clr.ImportExtensions(Revit.GeometryConversion)

clr.AddReference("RevitServices")
import RevitServices
from RevitServices.Persistence import DocumentManager
from RevitServices.Transactions import TransactionManager

doc = DocumentManager.Instance.CurrentDBDocument

if isinstance(IN[0], list):
	lines = []
	for i in IN[0]:
		lines.append(UnwrapElement(i))
else:
	lines = [UnwrapElement(IN[0])]


crvs = []

for line in lines:
	crvs.append(line.GeometryCurve)
	

#grids = UnwrapElement(IN[1])

"""gridRef = ReferenceArray()
opt = Options()
opt.ComputeReferences = True
opt.IncludeNonVisibleObjects = True
opt.View = doc.ActiveView
for grid in grids:
	for obj in grid.get_Geometry(opt):
		if isinstance(obj, Line):
			gline = obj
			gridRef.Append(gline.Reference)"""

TransactionManager.Instance.EnsureInTransaction(doc)


for crv in crvs:
	ref = ReferenceArray()
	ref.Append(crv.GetEndPointReference(0))
	ref.Append(crv.GetEndPointReference(1))
	dim = doc.Create.NewDimension(doc.ActiveView, crv, ref)

TransactionManager.Instance.TransactionTaskDone()

OUT = dim
# ----------------------------------------

# group: DIM. GRIDLINES
select_model_elements = DSModelElementsSelection()  # 3 picked in the model

curve = Grid.Curve(select_model_elements)
startPoint = Curve.StartPoint(curve)
firstItem = List.FirstItem(startPoint)
lastItem = List.LastItem(startPoint)
byStartPointEndPoint = Line.ByStartPointEndPoint(startPoint=firstItem, endPoint=lastItem)
code_block = CodeBlock { 500; }
offset = Curve.Offset(curve=byStartPointEndPoint, distance=code_block)
python_script_2 = Python(IN[0]=offset, IN[1]=select_model_elements)
# ---------- python_script_2.python (38 lines) ----------
import clr
clr.AddReference('RevitAPI')
from Autodesk.Revit.DB import *

clr.AddReference("RevitNodes")
import Revit
clr.ImportExtensions(Revit.Elements)
clr.ImportExtensions(Revit.GeometryConversion)

clr.AddReference("RevitServices")
import RevitServices
from RevitServices.Persistence import DocumentManager
from RevitServices.Transactions import TransactionManager

doc = DocumentManager.Instance.CurrentDBDocument

line = IN[0].ToRevitType()
grids = UnwrapElement(IN[1])

gridRef = ReferenceArray()
opt = Options()
opt.ComputeReferences = True
opt.IncludeNonVisibleObjects = True
opt.View = doc.ActiveView

for grid in grids:
	for obj in grid.get_Geometry(opt):
		if isinstance(obj, Line):
			gline = obj
			gridRef.Append(gline.Reference)

TransactionManager.Instance.EnsureInTransaction(doc)

dim = doc.Create.NewDimension(doc.ActiveView, line, gridRef)

TransactionManager.Instance.TransactionTaskDone()

OUT = dim
# ----------------------------------------

# group: DIM. LINES
select_model_elements_2 = DSModelElementsSelection()  # 3 picked in the model

# group: DIM. MULTIPLE LINES W/ OFFSET
select_model_elements_3 = DSModelElementsSelection()

curves = Element.Curves(select_model_elements_3)
code_block_2 = CodeBlock { -1000; }

# group: from Wombat
smartOffset = WombatDynamo.Curve.SmartOffset(curves, code_block_2)

flatten = Flatten(smartOffset)
python_script_3 = Python(IN[0]=select_model_elements_3, IN[1]=flatten)
# ---------- python_script_3.python (52 lines) ----------
import clr
clr.AddReference('RevitAPI')
from Autodesk.Revit.DB import *

clr.AddReference("RevitNodes")
import Revit
clr.ImportExtensions(Revit.Elements)
clr.ImportExtensions(Revit.GeometryConversion)

clr.AddReference("RevitServices")
import RevitServices
from RevitServices.Persistence import DocumentManager
from RevitServices.Transactions import TransactionManager

doc = DocumentManager.Instance.CurrentDBDocument

if isinstance(IN[0], list):
	lines = []
	for i in IN[0]:
		lines.append(UnwrapElement(i))
else:
	lines = [UnwrapElement(IN[0])]


crvs = []

for line in lines:
	crvs.append(line.GeometryCurve)


if isinstance(IN[1], list):
	linea = []
	for i in IN[1]:
		linea.append(UnwrapElement(i).ToRevitType())
else:
	linea = [UnwrapElement(IN[1]).ToRevitType()]


TransactionManager.Instance.EnsureInTransaction(doc)


for i in range (0,len(linea)):
	ref = ReferenceArray()
	ref.Append(crvs[i].GetEndPointReference(0))
	ref.Append(crvs[i].GetEndPointReference(1))
	dim = doc.Create.NewDimension(doc.ActiveView, linea[i], ref)



TransactionManager.Instance.TransactionTaskDone()

OUT = linea
# ----------------------------------------

# group: DIM. SLABS
select_model_elements_4 = DSModelElementsSelection()

code_block_3 = CodeBlock(a=select_model_elements_4) { {a}; }
python_script_4 = Python(IN[0]=code_block_3)
# ---------- python_script_4.python (56 lines) ----------
import clr
clr.AddReference('RevitAPI')
from Autodesk.Revit.DB import *

clr.AddReference("RevitNodes")
import Revit
clr.ImportExtensions(Revit.Elements)
clr.ImportExtensions(Revit.GeometryConversion)

clr.AddReference("RevitServices")
import RevitServices
from RevitServices.Persistence import DocumentManager
from RevitServices.Transactions import TransactionManager

doc = DocumentManager.Instance.CurrentDBDocument
uiapp = DocumentManager.Instance.CurrentUIApplication
app = uiapp.Application

if isinstance(IN[0], list):
	lines = []
	for i in IN[0]:
		lines.append(UnwrapElement(i))
else:
	lines = [UnwrapElement(IN[0])]


	
opt = app.Create.NewGeometryOptions()
opt.ComputeReferences = 1
opt.IncludeNonVisibleObjects = 1
opt.View = doc.ActiveView


lines = UnwrapElement(IN[0])

faceArray = []
edgeArray = []
edgeCurve = []


for r in lines:
	geomElem = r.get_Geometry(opt)
	enum1 = geomElem.GetEnumerator() ; enum1.MoveNext()
	geo2 = enum1.Current
	faceArray = geo2.Faces

for face in faceArray:
	edgeArray.append(face.EdgeLoops)

for edge in edgeArray[0][0]:
	edgeCurve.append(edge.AsCurve().ToProtoType())




OUT = edgeArray[0][0],edgeCurve
# ----------------------------------------
code_block_4 = CodeBlock(a=python_script_4) { a[0]; }
code_block_5 = CodeBlock(a=python_script_4) { a[1]; }
code_block_6 = CodeBlock { -1000; }

# group: from Wombat
smartOffset_2 = WombatDynamo.Curve.SmartOffset(code_block_5, code_block_6)

python_script_5 = Python(IN[0]=smartOffset_2)
# ---------- python_script_5.python (28 lines) ----------
import clr
clr.AddReference('RevitAPI')
from Autodesk.Revit.DB import *

clr.AddReference("RevitNodes")
import Revit
clr.ImportExtensions(Revit.Elements)
clr.ImportExtensions(Revit.GeometryConversion)

clr.AddReference("RevitServices")
import RevitServices
from RevitServices.Persistence import DocumentManager
from RevitServices.Transactions import TransactionManager

doc = DocumentManager.Instance.CurrentDBDocument
uiapp = DocumentManager.Instance.CurrentUIApplication
app = uiapp.Application

lines = IN[0]

edges = []

for l in lines:
	edges.append(l.ToRevitType())



OUT = edges
# ----------------------------------------

# group: reference
python_script_6 = Python(IN[0]=code_block_4, IN[1]=python_script_5)
# ---------- python_script_6.python (43 lines) ----------
import clr
clr.AddReference('RevitAPI')
from Autodesk.Revit.DB import *

clr.AddReference("RevitNodes")
import Revit
clr.ImportExtensions(Revit.Elements)
clr.ImportExtensions(Revit.GeometryConversion)

clr.AddReference("RevitServices")
import RevitServices
from RevitServices.Persistence import DocumentManager
from RevitServices.Transactions import TransactionManager

doc = DocumentManager.Instance.CurrentDBDocument
uiapp = DocumentManager.Instance.CurrentUIApplication
app = uiapp.Application


edgeArray = [IN[0]]

edgeCurves = [IN[1]]
	

dimensions = []

TransactionManager.Instance.EnsureInTransaction(doc)


for i in range(0,len(edgeArray)):
	for edge,crvs in zip(edgeArray[i],edgeCurves[i]):
		ref = ReferenceArray()
		ref.Append(edge.GetEndPointReference(0))
		ref.Append(edge.GetEndPointReference(1))
		dim = doc.Create.NewDimension(doc.ActiveView, crvs, ref)
		dimensions.append(dim)


TransactionManager.Instance.TransactionTaskDone()



OUT = dim
# ----------------------------------------

# group: DIM. LINES
select_model_elements_5 = DSModelElementsSelection()  # 3 picked in the model

curves_2 = Element.Curves()  # unwired: arg0
startPoint_2 = Curve.StartPoint(curves_2)
flatten_2 = Flatten(startPoint_2)
python_script_7 = Python(IN[0]=flatten_2)
# ---------- python_script_7.python (16 lines) ----------
import clr
clr.AddReference('ProtoGeometry')
from Autodesk.DesignScript.Geometry import *
#The inputs to this node will be stored as a list in the IN variables.
pts = UnwrapElement(IN[0])

crv = []

for i in range(0,len(pts)-1):
	crv.append(Line.ByStartPointEndPoint(pts[i],pts[i+1]))
	



#Assign your output to the OUT variable.
OUT = crv
# ----------------------------------------
get_revit_activeview = Custom[Get Revit ActiveView]()  # Active View
fromCurve = Custom[DetailLine.FromCurve](curve=python_script_7, view=get_revit_activeview)  # Creates a detail line based on a given curve
curves_3 = Element.Curves(fromCurve)
code_block_7 = CodeBlock { 10; }

# group: from Wombat
smartOffset_3 = WombatDynamo.Curve.SmartOffset(curves_3, code_block_7)

flatten_3 = Flatten(smartOffset_3)
python_script_8 = Python(IN[0]=fromCurve, IN[1]=flatten_3)  # same code as python_script_3
python_script_9 = Python()  # unwired: IN[0], IN[1]; same code as python_script_3
python_script_10 = Python()  # unwired: IN[0], IN[1]
# ---------- python_script_10.python (28 lines) ----------
import clr
clr.AddReference('RevitAPI')
from Autodesk.Revit.DB import *

clr.AddReference("RevitNodes")
import Revit
clr.ImportExtensions(Revit.GeometryConversion)

clr.AddReference("RevitServices")
import RevitServices
from RevitServices.Persistence import DocumentManager
from RevitServices.Transactions import TransactionManager

doc = DocumentManager.Instance.CurrentDBDocument
curves = UnwrapElement(IN[0])
view = UnwrapElement(IN[1])
elementlist = []

TransactionManager.Instance.EnsureInTransaction(doc)
if doc.IsFamilyDocument: 
	doc_create = doc.FamilyCreate
else: 
	doc_create = doc.Create
for curve in curves:
	detcurve = doc_create.NewDetailCurve(view, curve.ToRevitType())
	elementlist.append(detcurve)
TransactionManager.Instance.TransactionTaskDone()
OUT = elementlist
# ----------------------------------------

# group: DIM. GRIDLINES
select_model_elements_6 = DSModelElementsSelection()

curves_4 = Element.Curves(select_model_elements_6)
startPoint_3 = Curve.StartPoint(curves_4)
flatten_4 = Flatten(startPoint_3)
python_script_11 = Python(IN[0]=flatten_4)  # same code as python_script_7
code_block_8 = CodeBlock(a=python_script_11) { a[0]; }
code_block_9 = CodeBlock { 500; }
offset_2 = Curve.Offset(curve=code_block_8, distance=code_block_9)
python_script_12 = Python(IN[0]=offset_2, IN[1]=select_model_elements_6)  # same code as python_script_2
