# Dynamo graph Dimension Gridlines.dyn (Dynamo 0.8.2.2392)

# group: SELECT GRIDLINES
select_model_elements = DSModelElementsSelection()  # 6 picked in the model

curve = Grid.Curve(select_model_elements)
startPoint = Curve.StartPoint(curve)
firstItem = List.FirstItem(startPoint)
lastItem = List.LastItem(startPoint)
byStartPointEndPoint = Line.ByStartPointEndPoint(startPoint=firstItem, endPoint=lastItem)
code_block = CodeBlock { 500; }
offset = Curve.Offset(curve=byStartPointEndPoint, distance=code_block)
python_script = Python(IN[0]=offset, IN[1]=select_model_elements)
# ---------- python_script.python (37 lines) ----------
import clr
clr.AddReference('RevitAPI')
from Autodesk.Revit.DB import *

clr.AddReference("RevitNodes")
import Revit
clr.ImportExtensions(Revit.Elements)
clr.ImportExtensions(Revit.GeometryConversion)

clr.AddReference("RevitServices")
import RevitServices
from RevitServices.Persistence import DocumentManager
from RevitServices.Transactions import TransactionManager

doc = DocumentManager.Instance.CurrentDBDocument

line = IN[0].ToRevitType()
grids = UnwrapElement(IN[1])

gridRef = ReferenceArray()
opt = Options()
opt.ComputeReferences = True
opt.IncludeNonVisibleObjects = True
opt.View = doc.ActiveView
for grid in grids:
	for obj in grid.get_Geometry(opt):
		if isinstance(obj, Line):
			gline = obj
			gridRef.Append(gline.Reference)

TransactionManager.Instance.EnsureInTransaction(doc)

dim = doc.Create.NewDimension(doc.ActiveView, line, gridRef)

TransactionManager.Instance.TransactionTaskDone()

OUT = dim
# ----------------------------------------
