# Dynamo graph Dimension Line No offset01.dyn (Dynamo 0.8.2.2392)

select_model_elements = DSModelElementsSelection()  # 2 picked in the model
geometry = Element.Geometry(select_model_elements)
flatten = Flatten(geometry)
code_block = CodeBlock { 0.5; }
pointAtParameter = Curve.PointAtParameter(curve=geometry, param=code_block)
flatten_2 = Flatten(pointAtParameter)
code_block_2 = CodeBlock(a=geometry) { a.Length; }
code_block_3 = CodeBlock(a=code_block_2) { a-4000; }
code_block_4 = CodeBlock(a=code_block_3, b=code_block_2) { a/b; }
flatten_3 = Flatten(code_block_4)
python_script = Python(IN[0]=flatten, IN[1]=flatten_2, IN[2]=flatten_3)
# ---------- python_script.python (16 lines) ----------
import clr
clr.AddReference('ProtoGeometry')
from Autodesk.DesignScript.Geometry import *
#The inputs to this node will be stored as a list in the IN variables.
geo = UnwrapElement(IN[0])
pts = UnwrapElement(IN[1])
scaleF = IN[2]
BPlane = []
Scalate = []

for i in range(0,len(geo)):
	BPlane = Plane.ByOriginNormal(pts[i],Vector.ZAxis())
	Scalate.append(Geometry.Scale(geo[i],BPlane,scaleF[i],scaleF[i],scaleF[i]))

#Assign your output to the OUT variable.
OUT = Scalate
# ----------------------------------------
active_view = Custom[Active View]()
py_detail_line_from_curve = Python(IN[0]=python_script, IN[1]=active_view)
# ---------- py_detail_line_from_curve.python (28 lines) ----------
import clr
clr.AddReference('RevitAPI')
from Autodesk.Revit.DB import *

clr.AddReference("RevitNodes")
import Revit
clr.ImportExtensions(Revit.GeometryConversion)

clr.AddReference("RevitServices")
import RevitServices
from RevitServices.Persistence import DocumentManager
from RevitServices.Transactions import TransactionManager

doc = DocumentManager.Instance.CurrentDBDocument
curves = UnwrapElement(IN[0])
view = UnwrapElement(IN[1])
elementlist = []

TransactionManager.Instance.EnsureInTransaction(doc)
if doc.IsFamilyDocument: 
	doc_create = doc.FamilyCreate
else: 
	doc_create = doc.Create
for curve in curves:
	detcurve = doc_create.NewDetailCurve(view, curve.ToRevitType())
	elementlist.append(detcurve)
TransactionManager.Instance.TransactionTaskDone()
OUT = elementlist
# ----------------------------------------
code_block_5 = CodeBlock { 1000; }
offset = Curve.Offset(curve=python_script, distance=code_block_5)
python_script_2 = Python(IN[0]=py_detail_line_from_curve, IN[1]=offset)
# ---------- python_script_2.python (48 lines) ----------
import clr
clr.AddReference('RevitAPI')
from Autodesk.Revit.DB import *

clr.AddReference("RevitNodes")
import Revit
clr.ImportExtensions(Revit.Elements)
clr.ImportExtensions(Revit.GeometryConversion)

clr.AddReference("RevitServices")
import RevitServices
from RevitServices.Persistence import DocumentManager
from RevitServices.Transactions import TransactionManager

doc = DocumentManager.Instance.CurrentDBDocument


lines = UnwrapElement(IN[0])

crvs = []

for line in lines:
	crvs.append(line.GeometryCurve)


if isinstance(IN[1], list):
	linea = []
	for i in IN[1]:
		linea.append(UnwrapElement(i).ToRevitType())
else:
	linea = [UnwrapElement(IN[1]).ToRevitType()]


TransactionManager.Instance.EnsureInTransaction(doc)

for i in range (0,len(linea)):
	ref = ReferenceArray()
	ref.Append(crvs[i].GetEndPointReference(0))
	ref.Append(crvs[i].GetEndPointReference(1))
	dim = doc.Create.NewDimension(doc.ActiveView, linea[i], ref)
	



TransactionManager.Instance.TransactionTaskDone()


OUT = crvs
# ----------------------------------------
direction = Line.Direction(flatten)
normalized = Vector.Normalized(direction)
code_block_6 = CodeBlock { Vector.ZAxis(); }
code_block_7 = CodeBlock { 90; }
rotate = Vector.Rotate(normalized, code_block_6, code_block_7)
code_block_8 = CodeBlock { 1000; }
scale = Vector.Scale(vector=rotate, scale_factor=code_block_8)
python_script_3 = Python()
# ---------- python_script_3.python (31 lines) ----------
import clr
clr.AddReference('RevitAPI')
from Autodesk.Revit.DB import *

clr.AddReference('RevitNodes')
import Revit
clr.ImportExtensions(Revit.GeometryConversion)
clr.ImportExtensions(Revit.Elements)

clr.AddReference('RevitServices')
import RevitServices
from RevitServices.Persistence import DocumentManager
from RevitServices.Transactions import TransactionManager

doc = DocumentManager.Instance.CurrentDBDocument

#Converting input from Dynamo to Revit
line = UnwrapElement(IN[0]).GeometryCurve

ref = ReferenceArray()
ref.Append(line.GetEndPointReference(0))
ref.Append(line.GetEndPointReference(1))

#Create the dimension in a transaction
TransactionManager.Instance.EnsureInTransaction(doc)

dim = doc.Create.NewDimension(doc.ActiveView, line, ref)

TransactionManager.Instance.TransactionTaskDone()

OUT = dim
# ----------------------------------------
elementCurveReference = CurveElement.ElementCurveReference()
