# Dynamo graph Dimension Line No offset02.dyn (Dynamo 0.8.2.2392)

select_model_elements = DSModelElementsSelection()  # 106 picked in the model
geometry = Element.Geometry(select_model_elements)
flatten = Flatten(geometry)
code_block = CodeBlock(a=flatten) { a.Length>500; }
filterByBoolMask = List.FilterByBoolMask(list=select_model_elements, mask=code_block)
geometry_2 = Element.Geometry(filterByBoolMask.in)
flatten_2 = Flatten(geometry_2)
code_block_2 = CodeBlock { 0.5; }
pointAtParameter = Curve.PointAtParameter(curve=geometry_2, param=code_block_2)
flatten_3 = Flatten(pointAtParameter)
code_block_3 = CodeBlock(a=geometry_2) { a.Length; }
code_block_4 = CodeBlock(a=code_block_3) { a-4000; }
code_block_5 = CodeBlock(a=code_block_4, b=code_block_3) { a/b; }
flatten_4 = Flatten(code_block_5)
python_script = Python(IN[0]=flatten_2, IN[1]=flatten_3, IN[2]=flatten_4)
# ---------- python_script.python (16 lines) ----------
import clr
clr.AddReference('ProtoGeometry')
from Autodesk.DesignScript.Geometry import *
#The inputs to this node will be stored as a list in the IN variables.
geo = UnwrapElement(IN[0])
pts = UnwrapElement(IN[1])
scaleF = IN[2]
BPlane = []
Scalate = []

for i in range(0,len(geo)):
	BPlane = Plane.ByOriginNormal(pts[i],Vector.ZAxis())
	Scalate.append(Geometry.Scale(geo[i],BPlane,scaleF[i],scaleF[i],scaleF[i]))

#Assign your output to the OUT variable.
OUT = Scalate
# ----------------------------------------
code_block_6 = CodeBlock { 1; }
simplify = Curve.Simplify(python_script, code_block_6)
code_block_7 = CodeBlock { 1; }
active_view = Custom[Active View](refresh=code_block_7)
py_detail_line_from_curve = Python(IN[0]=simplify, IN[1]=active_view)
# ---------- py_detail_line_from_curve.python (28 lines) ----------
import clr
clr.AddReference('RevitAPI')
from Autodesk.Revit.DB import *

clr.AddReference("RevitNodes")
import Revit
clr.ImportExtensions(Revit.GeometryConversion)

clr.AddReference("RevitServices")
import RevitServices
from RevitServices.Persistence import DocumentManager
from RevitServices.Transactions import TransactionManager

doc = DocumentManager.Instance.CurrentDBDocument
curves = UnwrapElement(IN[0])
view = UnwrapElement(IN[1])
elementlist = []

TransactionManager.Instance.EnsureInTransaction(doc)
if doc.IsFamilyDocument: 
	doc_create = doc.FamilyCreate
else: 
	doc_create = doc.Create
for curve in curves:
	detcurve = doc_create.NewDetailCurve(view, curve.ToRevitType())
	elementlist.append(detcurve)
TransactionManager.Instance.TransactionTaskDone()
OUT = elementlist
# ----------------------------------------
python_script_2 = Python(IN[0]=py_detail_line_from_curve)
# ---------- python_script_2.python (40 lines) ----------
import clr
clr.AddReference('RevitAPI')
from Autodesk.Revit.DB import *

clr.AddReference('RevitNodes')
import Revit
clr.ImportExtensions(Revit.GeometryConversion)
clr.ImportExtensions(Revit.Elements)

clr.AddReference('RevitServices')
import RevitServices
from RevitServices.Persistence import DocumentManager
from RevitServices.Transactions import TransactionManager

doc = DocumentManager.Instance.CurrentDBDocument

#Converting input from Dynamo to Revit

lineList = UnwrapElement(IN[0])

line = []

for ln in lineList:
	line.append(ln.GeometryCurve)




#Create the dimension in a transaction
TransactionManager.Instance.EnsureInTransaction(doc)

for l in line:
	ref = ReferenceArray()
	ref.Append(l.GetEndPointReference(0))
	ref.Append(l.GetEndPointReference(1))
	dim = doc.Create.NewDimension(doc.ActiveView, l, ref)

TransactionManager.Instance.TransactionTaskDone()

OUT = dim
# ----------------------------------------
