# Dynamo graph Dimension Line No offset03.dyn (Dynamo 0.8.2.2392)

select_model_elements = DSModelElementsSelection()
geometry = Element.Geometry(select_model_elements)
flatten = Flatten(geometry)
code_block = CodeBlock(a=flatten) { a.Length>500; }
filterByBoolMask = List.FilterByBoolMask(list=select_model_elements, mask=code_block)
geometry_2 = Element.Geometry(filterByBoolMask.in)
flatten_2 = Flatten(geometry_2)
code_block_2 = CodeBlock { 0.5; }
pointAtParameter = Curve.PointAtParameter(curve=geometry_2, param=code_block_2)
flatten_3 = Flatten(pointAtParameter)
code_block_3 = CodeBlock(a=geometry_2) { a.Length; }
code_block_4 = CodeBlock(a=code_block_3) { a-4000; }
code_block_5 = CodeBlock(a=code_block_4, b=code_block_3) { a/b; }
flatten_4 = Flatten(code_block_5)
python_script = Python(IN[0]=flatten_2, IN[1]=flatten_3, IN[2]=flatten_4)
# ---------- python_script.python (16 lines) ----------
import clr
clr.AddReference('ProtoGeometry')
from Autodesk.DesignScript.Geometry import *
#The inputs to this node will be stored as a list in the IN variables.
geo = UnwrapElement(IN[0])
pts = UnwrapElement(IN[1])
scaleF = IN[2]
BPlane = []
Scalate = []

for i in range(0,len(geo)):
	BPlane = Plane.ByOriginNormal(pts[i],Vector.ZAxis())
	Scalate.append(Geometry.Scale(geo[i],BPlane,scaleF[i],scaleF[i],scaleF[i]))

#Assign your output to the OUT variable.
OUT = Scalate
# ----------------------------------------
code_block_6 = CodeBlock { 1; }
simplify = Curve.Simplify(python_script, code_block_6)
code_block_7 = CodeBlock { 1; }
active_view = Custom[Active View](refresh=code_block_7)
py_detail_line_from_curve = Python(IN[0]=simplify, IN[1]=active_view)
# ---------- py_detail_line_from_curve.python (28 lines) ----------
import clr
clr.AddReference('RevitAPI')
from Autodesk.Revit.DB import *

clr.AddReference("RevitNodes")
import Revit
clr.ImportExtensions(Revit.GeometryConversion)

clr.AddReference("RevitServices")
import RevitServices
from RevitServices.Persistence import DocumentManager
from RevitServices.Transactions import TransactionManager

doc = DocumentManager.Instance.CurrentDBDocument
curves = UnwrapElement(IN[0])
view = UnwrapElement(IN[1])
elementlist = []

TransactionManager.Instance.EnsureInTransaction(doc)
if doc.IsFamilyDocument: 
	doc_create = doc.FamilyCreate
else: 
	doc_create = doc.Create
for curve in curves:
	detcurve = doc_create.NewDetailCurve(view, curve.ToRevitType())
	elementlist.append(detcurve)
TransactionManager.Instance.TransactionTaskDone()
OUT = elementlist
# ----------------------------------------
python_script_2 = Python(IN[0]=py_detail_line_from_curve)
# ---------- python_script_2.python (40 lines) ----------
import clr
clr.AddReference('RevitAPI')
from Autodesk.Revit.DB import *

clr.AddReference('RevitNodes')
import Revit
clr.ImportExtensions(Revit.GeometryConversion)
clr.ImportExtensions(Revit.Elements)

clr.AddReference('RevitServices')
import RevitServices
from RevitServices.Persistence import DocumentManager
from RevitServices.Transactions import TransactionManager

doc = DocumentManager.Instance.CurrentDBDocument

#Converting input from Dynamo to Revit

lineList = UnwrapElement(IN[0])

line = []

for ln in lineList:
	line.append(ln.GeometryCurve)




#Create the dimension in a transaction
TransactionManager.Instance.EnsureInTransaction(doc)

for l in line:
	ref = ReferenceArray()
	ref.Append(l.GetEndPointReference(0))
	ref.Append(l.GetEndPointReference(1))
	dim = doc.Create.NewDimension(doc.ActiveView, l, ref)

TransactionManager.Instance.TransactionTaskDone()

OUT = dim
# ----------------------------------------
levels = Levels("Level 1")
levels_2 = Levels("Level 2")
wall_types = WallTypes("Wall 1")
byCurveAndLevels = Wall.ByCurveAndLevels(arg1=levels, arg2=levels_2, arg3=wall_types)
select_model_elements_2 = DSModelElementsSelection()
geometry_3 = Element.Geometry(select_model_elements_2)
select_model_elements_3 = DSModelElementsSelection()  # 2 picked in the model
curve = Grid.Curve(select_model_elements_3)
python_script_3 = Python()
# ---------- python_script_3.python (40 lines) ----------
import clr
clr.AddReference('RevitAPI')
from Autodesk.Revit.DB import *

clr.AddReference('RevitNodes')
import Revit
clr.ImportExtensions(Revit.GeometryConversion)
clr.ImportExtensions(Revit.Elements)

clr.AddReference('RevitServices')
import RevitServices
from RevitServices.Persistence import DocumentManager
from RevitServices.Transactions import TransactionManager

doc = DocumentManager.Instance.CurrentDBDocument

#Converting input from Dynamo to Revit

lineList = UnwrapElement(IN[0])

line = []

for ln in lineList:
	line.append(ln.GeometryCurve)




#Create the dimension in a transaction
TransactionManager.Instance.EnsureInTransaction(doc)

for l in line:
	ref = ReferenceArray()
	ref.Append(l.GetEndPointReference(0))
	ref.Append(l.GetEndPointReference(1))
	dim = doc.Create.NewDimension(doc.ActiveView, l, ref)

TransactionManager.Instance.TransactionTaskDone()

OUT = dim,ref
# ----------------------------------------
intersect = Geometry.Intersect(lacing=CrossProduct)
flatten_5 = Flatten(intersect)
code_block_8 = CodeBlock(a=flatten_5, b=flatten_5) { a[0]; b[1]; }
byStartPointEndPoint = Line.ByStartPointEndPoint(startPoint=code_block_8.out0, endPoint=code_block_8.out1)
create = List.Create(byStartPointEndPoint)
code_block_9 = CodeBlock { 1; }
active_view_2 = Custom[Active View](refresh=code_block_9)
py_detail_line_from_curve_2 = Python(IN[0]=create, IN[1]=active_view_2)  # same code as py_detail_line_from_curve
select_model_elements_4 = DSModelElementsSelection()  # 1 picked in the model
geometry_4 = Element.Geometry(select_model_elements_4)
flatten_6 = Flatten(geometry_4)
code_block_10 = CodeBlock(a=flatten_6) { a[0]; }
python_script_4 = Python(IN[0]=code_block_10, IN[1]=select_model_elements_3)
# ---------- python_script_4.python (40 lines) ----------
import clr
clr.AddReference('RevitAPI')
from Autodesk.Revit.DB import *

clr.AddReference('RevitNodes')
import Revit
clr.ImportExtensions(Revit.GeometryConversion)
clr.ImportExtensions(Revit.Elements)

clr.AddReference('RevitServices')
import RevitServices
from RevitServices.Persistence import DocumentManager
from RevitServices.Transactions import TransactionManager

doc = DocumentManager.Instance.CurrentDBDocument

#Converting input from Dynamo to Revit
line = IN[0].ToRevitType()
grids = UnwrapElement(IN[1])

#Getting refrences from grid
gridRef = ReferenceArray()
opt = Options()
opt.ComputeReferences = True
opt.IncludeNonVisibleObjects = True
opt.View = doc.ActiveView
for grid in grids:
	for obj in grid.get_Geometry(opt):
		if isinstance(obj, Line):
			gline = obj
			gridRef.Append(gline.Reference)

#Create the dimension in a transaction
TransactionManager.Instance.EnsureInTransaction(doc)

dim = doc.Create.NewDimension(doc.ActiveView, line, gridRef)

TransactionManager.Instance.TransactionTaskDone()

OUT = dim
# ----------------------------------------
