# Dynamo graph DimensionMultipleLinesV08.dyn (Dynamo 0.8.2.2392)

# group: alignment line
select_model_elements = DSModelElementsSelection()

curves = Element.Curves(select_model_elements)
code_block = CodeBlock(a=curves) { a[0]; }

# group: beams
select_model_elements_2 = DSModelElementsSelection()  # 10 picked in the model

python_script = Python(IN[0]=code_block, IN[1]=select_model_elements_2)
# ---------- python_script.python (38 lines) ----------
import clr
clr.AddReference('RevitAPI')
from Autodesk.Revit.DB import *

clr.AddReference("RevitNodes")
import Revit
clr.ImportExtensions(Revit.Elements)
clr.ImportExtensions(Revit.GeometryConversion)

clr.AddReference("RevitServices")
import RevitServices
from RevitServices.Persistence import DocumentManager
from RevitServices.Transactions import TransactionManager

doc = DocumentManager.Instance.CurrentDBDocument

line = IN[0].ToRevitType()
grids = UnwrapElement(IN[1])

gridRef = ReferenceArray()
opt = Options()
opt.ComputeReferences = True
opt.IncludeNonVisibleObjects = False
opt.View = doc.ActiveView

for grid in grids:
	for obj in grid.get_Geometry(opt):
		if isinstance(obj, Line):
			gline = obj
			gridRef.Append(gline.Reference)

TransactionManager.Instance.EnsureInTransaction(doc)

dim = doc.Create.NewDimension(doc.ActiveView, line, gridRef)

TransactionManager.Instance.TransactionTaskDone()

OUT = dim, gridRef
# ----------------------------------------
