# Dynamo graph Set Dimension Value Below.dyn (Dynamo 0.8.2.2392)

select_model_element = DSModelElementSelection()
dimension_multisegment = Custom[Dimension Multisegment](multiSegmentDimension=select_model_element)
flatten = Flatten(dimension_multisegment)
code_block = CodeBlock { "typp"; }
count = Count(flatten)
cycle = List.Cycle(list=code_block, amount=count)
setOverrideValue = Custom[Dimension.SetOverrideValue](dimension=flatten, belowValue=cycle)
select_model_elements = DSModelElementsSelection()  # 246 picked in the model
name = Element.Name(select_model_elements)
code_block_2 = CodeBlock { "RM_2.5mm"; }
filter_by_element_name = Custom[Filter By Element Name](Search_For=code_block_2, Elements=select_model_elements)
code_block_3 = CodeBlock { " "; }
count_2 = Count(filter_by_element_name.Elements)
cycle_2 = List.Cycle(list=code_block_3, amount=count_2)
setOverrideValue_2 = Custom[Dimension.SetOverrideValue](dimension=filter_by_element_name.Elements, belowValue=cycle_2)
