# Dynamo graph Set Dimension Value Override.dyn (Dynamo 0.8.2.2392)

code_block = CodeBlock { "RM_2.5mm"; }
select_model_elements = DSModelElementsSelection()  # 227 picked in the model
filter_by_element_name = Custom[Filter By Element Name](Search_For=code_block, Elements=select_model_elements)
count = Count(filter_by_element_name.Elements)
code_block_2 = CodeBlock { "typp"; }
select_model_element = DSModelElementSelection()
dimension_multisegment = Custom[Dimension Multisegment](multiSegmentDimension=select_model_element)
flatten = Flatten(dimension_multisegment)
count_2 = Count(flatten)
cycle = List.Cycle(list=code_block_2, amount=count_2)
setOverrideValue = Custom[Dimension.SetOverrideValue](dimension=flatten)
name = Element.Name(select_model_elements)
boolean = BoolSelector(true)
pick_element = Custom[Pick Element](refresh=boolean)
code_block_3 = CodeBlock { "TL"; }
count_3 = Count(pick_element)
cycle_2 = List.Cycle(list=code_block_3, amount=count_3)
setOverrideValue_2 = Custom[Dimension.SetOverrideValue](dimension=pick_element, belowValue=cycle_2)
python_script = Python(IN[0]=filter_by_element_name.Elements)
# ---------- python_script.python (31 lines) ----------
import clr
clr.AddReference('RevitAPI')
from Autodesk.Revit.DB import *

clr.AddReference("RevitNodes")
import Revit
clr.ImportExtensions(Revit.Elements)

clr.AddReference("RevitServices")
import RevitServices
from RevitServices.Persistence import DocumentManager
from RevitServices.Transactions import TransactionManager

doc = DocumentManager.Instance.CurrentDBDocument
items = UnwrapElement(IN[0])

goodlist = list()
badlist = list()
counter = 0

TransactionManager.Instance.EnsureInTransaction(doc)
while counter < len(items):
	try:
		items[counter].Value
		goodlist.append(items[counter].Value)
	except:
		badlist.append(items[counter])
	counter += 1
TransactionManager.Instance.TransactionTaskDone()

OUT = (goodlist,badlist)
# ----------------------------------------
removeNulls = Lists.Manage.RemoveNulls(python_script)
code_block_4 = CodeBlock(a=removeNulls) { a/0.00328084; }
code_block_5 = CodeBlock(a=code_block_4) { a[0]; }
ceiling = Math.Ceiling(code_block_5)
string_from_object = FromObject(ceiling)
code_block_6 = CodeBlock { "2000"; }
eq = string_from_object == code_block_6
filterByBoolMask = List.FilterByBoolMask(list=filter_by_element_name.Elements, mask=eq)
code_block_7 = CodeBlock { "1000+TL"; }
