# Dynamo graph DrawDetail.dyn (Dynamo 1.3.1.1736)

origin = Point.Origin()
family_types = FamilyTypes("WallSection:WallSection")
get_revit_activeview = Custom[Get Revit ActiveView]()  # Active View
byPointInView = Custom[FamilyInstance.ByPointInView](familyType=family_types, view=get_revit_activeview)  # Places a family instance at a given point in a given view (e.g. a detail component).; unwired: point
family_types_2 = FamilyTypes("Detail_Items_UK-Angles_Sec:UKA100x100x10")
select_model_elements = DSModelElementsSelection()  # 4 picked in the model
name = Element.Name(select_model_elements)
code_block = CodeBlock { "Wall"; }
contains = String.Contains(str=name, searchFor=code_block)
filterByBoolMask = List.FilterByBoolMask(list=select_model_elements, mask=contains)

# group: Wall_Width
code_block_2 = CodeBlock { "Wall_Width"; }
code_block_3 = CodeBlock { 600; }

setParameterByName = Element.SetParameterByName(element=filterByBoolMask.in, parameterName=code_block_2, value=code_block_3)
code_block_4 = CodeBlock { Autodesk.Point.ByCoordinates(a/2,0,0); }  # unwired: a
family_types_3 = FamilyTypes("Detail_Items_UK-Angles_Sec:UKA100x100x10")
get_revit_activeview_2 = Custom[Get Revit ActiveView]()
byPointInView_2 = Custom[FamilyInstance.ByPointInView](point=code_block_4, familyType=family_types_3, view=get_revit_activeview_2)
code_block_5 = CodeBlock { {"cx"}; }
code_block_6 = CodeBlock { "UKA"; }
contains_2 = String.Contains(str=name, searchFor=code_block_6)
filterByBoolMask_2 = List.FilterByBoolMask(list=select_model_elements, mask=contains_2)
code_block_7 = CodeBlock { "Type"; }

# group: ANGLE TYPE
code_block_8 = CodeBlock { "UKA120x120x10"; }

byName = FamilyType.ByName(code_block_8)
setParameterByName_2 = Element.SetParameterByName(element=filterByBoolMask_2.in, parameterName=code_block_7, value=byName)
code_block_9 = CodeBlock { "M"; }
contains_3 = String.Contains(str=name, searchFor=code_block_9)
filterByBoolMask_3 = List.FilterByBoolMask(list=select_model_elements, mask=contains_3)
code_block_10 = CodeBlock { "Type"; }

# group: ANGLE TYPE
code_block_11 = CodeBlock { "M16"; }

byName_2 = FamilyType.ByName(code_block_11)
setParameterByName_3 = Element.SetParameterByName(element=filterByBoolMask_3.in, parameterName=code_block_10, value=byName_2)
