# Dynamo graph DynamoTraining01.dyn (Dynamo 1.2.3.592)

file_path = Filename("C:\Program Files\Oasys\GSA 8.7\Samples\Stair.gwb")
openModel = DynamoTraining01.DynaGsa.OpenModel(file_path)
openModel_2 = DynamoTraining01.DynaGsa.OpenModel(file_path)
code_block = CodeBlock { "all"; }
elements = DynamoTraining01.DynaGsa.Elements(openModel_2, code_block)
nodesFromRefs = DynamoTraining01.DynaGsa.NodesFromRefs(openModel_2, elements.out1)
code_block_2 = CodeBlock { 0; }
getItemAtIndex = List.GetItemAtIndex(list=nodesFromRefs.out1, index=code_block_2, lacing=Longest)
code_block_3 = CodeBlock { 1; }
getItemAtIndex_2 = List.GetItemAtIndex(list=nodesFromRefs.out1, index=code_block_3, lacing=Longest)
byStartPointEndPoint = Line.ByStartPointEndPoint(startPoint=getItemAtIndex, endPoint=getItemAtIndex_2)
code_block_4 = CodeBlock { 1000; }
scale = Geometry.Scale(geometry=byStartPointEndPoint, xamount=code_block_4, yamount=code_block_4, zamount=code_block_4)
levels = Levels("00")
structural_framing_types = StructuralFramingTypes("RHS100x60x4")
beamByCurve = StructuralFraming.BeamByCurve(curve=scale, level=levels, structuralFramingType=structural_framing_types)
length = Curve.Length(byStartPointEndPoint)
