# Dynamo graph Dyno Workflow.dyn (Dynamo 1.1.0.2094)

code_block = CodeBlock { "cognome"; }
code_block_2 = CodeBlock { "nome"; }
create = List.Create(code_block, code_block_2)
code_block_3 = CodeBlock { "ciao"; }
code_block_4 = CodeBlock { 5; }
code_block_5 = CodeBlock { "ds"; }
dynoPresetInputGenerator = Custom[DynoPresetInputGenerator](Input_Name=code_block_3, Input_Value=code_block_4, Desc=code_block_5)
dynoPresetGenerator = Custom[DynoPresetGenerator](Preset_Name=create, Preset_Input_s=dynoPresetInputGenerator)
jsonGenerator = Custom[Dyno.JsonGenerator](Presets=dynoPresetGenerator)
watch = Watch(jsonGenerator)
