# Dynamo custom node Dyno.JsonGenerator.dyf (Dynamo 1.1.0.2094)
# category: Dyno

Presets = Input()
python_script = Python(IN[0]=Presets)
# ---------- python_script.python (20 lines) ----------
import clr
clr.AddReference('ProtoGeometry')
from Autodesk.DesignScript.Geometry import *
#The inputs to this node will be stored as a list in the IN variables.
dataEnteringNode = IN

input=IN[0]

header = '{ \n"hideOriginal" : true, \n"presets" : {\n'
outer = '\n } \n }'

b = ',\n\t'.join(str(input))

if type(input) == list:
	OUT = str(header)+str(b)+str(outer)
elif type(input) == str:
	OUT = str(header)+str(input)+str(outer)

else:
	OUT = "Error"
# ----------------------------------------
json_file_content = Output(python_script)
