# Dynamo custom node DynoPresetGenerator.dyf (Dynamo 1.1.0.2094)
# category: Dyno

Preset_Name = Input()
Preset_Input_s = Input()  # "Preset Input(s)"
python_script = Python(IN[0]=Preset_Name, IN[1]=Preset_Input_s)
# ---------- python_script.python (22 lines) ----------
import clr
clr.AddReference('ProtoGeometry')
from Autodesk.DesignScript.Geometry import *
#The inputs to this node will be stored as a list in the IN variables.
dataEnteringNode = IN

name = IN[0]
input = IN[1]


if type(input) == str:

	a='"'+str(name)+'" : {\n\t'+str(input)+'}'
	OUT = a

elif type(input) == list:

	b=',\n\t'.join(str(input))
	OUT = '"+str(name)" : {\n\t'+str(b)+'\n\t}'

else: 
	OUT = "error"
# ----------------------------------------
Preset_Definition = Output(python_script)
