# Dynamo graph Element View Generation Not.dyn (Dynamo 1.0.0.1180)

# group: STRUCTURAL FRAMING
categories = Categories("StructuralFraming")
# note: Object.Identity as placeholder
# in case you want to change the input mode
all_elements_of_category = ElementsOfCategory(categories)
identity = Object.Identity(all_elements_of_category)
location = StructuralFraming.Location(identity)

# group: DEFINITION OF VIEW NAMES
code_block = CodeBlock { "Mark"; }
getParameterValueByName = Element.GetParameterValueByName(element=identity, parameterName=code_block)
code_block_2 = CodeBlock(Suffix=getParameterValueByName) { "Top - " + Suffix; }
code_block_3 = CodeBlock(Suffix=getParameterValueByName) { "Cross - " + Suffix; }
code_block_4 = CodeBlock(Suffix=getParameterValueByName) { "Front - " + Suffix; }
y_vector_list_create = List.Create(code_block_2, code_block_3, code_block_4)
transpose = List.Transpose(y_vector_list_create)
flatten = Flatten(transpose)

byCurve = ModelCurve.ByCurve()
geometry = Element.Geometry()
select_model_element = DSModelElementSelection()  # 1 picked in the model
geometry_2 = Element.Geometry(select_model_element)
curves = Element.Curves(select_model_element)

# group: STRUCTURAL FRAMING LOCAL AXIS DIRECTION
boolean = BoolSelector(false)
reverse = Curve.Reverse(curves)
# note: Reverse section views ?
if_ = If(test=boolean, true=reverse, false=curves)
X = Line.Direction(if_)  # "Vector.X"
# note: Normal vector in local y-dir
code_block_5 = CodeBlock { 0; }
Y = Curve.NormalAtParameter(curve=if_, param=code_block_5)  # "Vector.Y"
# note: Normal vector in local z-dir
code_block_6 = CodeBlock { -90; }
Z = Vector.Rotate(Y, X, code_block_6)  # "Vector.Z"

# group: VECTOR DEFINITION STRUCTURAL FRAMING
flatten_2 = Flatten(X)
flatten_3 = Flatten(Z)

# group: BOUNDARY OFFSETS
offset_around_element_number = DoubleSlider(500, range=50..2000 step 100)  # "Offset around element / Number Slider"
view_depth_number_slider = DoubleSlider(1000, range=50..2000 step 100)

code_block_7 = CodeBlock { "section2"; }

# group: INPUT VALUES
geometry_3 = Element.Geometry(identity)
flatten_4 = Flatten(geometry_3)
# note: X defines the length direction of the section view
# note: Y defines the width direction of the section view
# note: Distance between object countours and section crop region
code_block_8 = CodeBlock(CropRegionOffset=offset_around_element_number) { CropRegionOffset:double; }
code_block_9 = CodeBlock(ViewDepth=view_depth_number_slider) { ViewDepth:double; }
code_block_10 = CodeBlock(Viewname=code_block_7) { Viewname; }

# group: APPLY CS AND WORKPLANE
centroid = Solid.Centroid(flatten_4)
# note: Defines the coordinate system for the direction of the section view.
# This is taken in the centroid of the solid geometry to be able to define negative and positive values for the min/max point
# Top view:
# X=length axis element
# Y=normal at length axis
# Front view:
# X=length axis element
# Y=Global Z axis
# Cross section view:
# X=normal axis element
# Y=Global Z axis
byOriginVectors = CoordinateSystem.ByOriginVectors(origin=centroid, xAxis=flatten_2, yAxis=flatten_3, lacing=Longest)
# note: Generate a plane at the solid center which is orientated to the view cs. This plane is used to detect the boundaries of the section view.
byOriginXAxisYAxis = Plane.ByOriginXAxisYAxis(centroid, flatten_2, flatten_3, lacing=Longest)

# group: DETECT SECTION BOUNDARY CURVES AND WORKPOINTS
intersect = Geometry.Intersect(geometry=flatten_4, other=byOriginXAxisYAxis, lacing=Longest)
# note: Detect the perimeter curves of the cutting surface at the solid centroid
flatten_5 = Flatten(intersect)
perimeterCurves = Surface.PerimeterCurves(flatten_5)
byJoinedCurves = PolyCurve.ByJoinedCurves(perimeterCurves)
code_block_11 = CodeBlock(x=code_block_8) { {x,-x}; }
# note: Apply the offset on the cutting surface perimeter curves.
offset = Curve.Offset(curve=byJoinedCurves, distance=code_block_11, lacing=CrossProduct)
isNull = Object.IsNull(offset)
# note: If the offset value exceeds the half-width of the surface, then it generates a "null" value for the generated polycurve.
# This might return an error in the Curve.Offset node. To filter out the "null" values, the List.FilterByBoolMask is used.
filterByBoolMask = List.FilterByBoolMask(list=offset, mask=isNull)
length = Curve.Length()
# note: Get the external polycurve of the offsetted polycurves.
maximumItemByKey = MaximumItemByKey(arg1=length)
map = List.Map(list=filterByBoolMask.out, f_x=maximumItemByKey)
# note: Get the single curves and their starting point to define the min and max boundary values
explode = Geometry.Explode(map)
startPoint = Curve.StartPoint(explode)

# group: TRANSLATE TO WCS FOR minPoint / maxPoint Calc
identity_2 = CoordinateSystem.Identity()
transform = Geometry.Transform(contextCoordinateSystem=identity_2)
# note: As Point.X and Point.Y only work according to global WCS, the curves are transformed from the solid.centroid to the WCS in order to define the MinPoint and MaxPoint of the cut surface (offset values already included)
combine = List.Combine(transform, startPoint, byOriginVectors)
X_2 = Point.X(combine)
minimumItem = List.MinimumItem(X_2)
Y_2 = Point.Y(combine)
minimumItem_2 = List.MinimumItem(Y_2)
maximumItem = List.MaximumItem(X_2)
maximumItem_2 = List.MaximumItem(Y_2)

# group: CREATE SECTION VIEW ACCORDING BOUNDING BOX
code_block_12 = CodeBlock(CropRegionOffset=code_block_8, ViewDepth=code_block_9)
# ---------- code_block_12.designscript (7 lines) ----------
//Z value calculation
//in accordance with the
//Centroid point
//Startingpoint of sectionview
-CropRegionOffset;
//Relative depth of sectionview
ViewDepth-CropRegionOffset;
# ----------------------------------------
byCoordinates = Point.ByCoordinates(x=minimumItem, y=minimumItem_2, z=code_block_12.out0)
byCoordinates_2 = Point.ByCoordinates(x=maximumItem, y=maximumItem_2, z=code_block_12.out1)
byCoordinateSystemMinPointMaxPoint = SectionView.ByCoordinateSystemMinPointMaxPoint(byOriginVectors, byCoordinates, byCoordinates_2)
# note: The section view is created according the CS, defined by the centroid and the given section view direction.
# The minPoint / maxPoint is defined by the local oriented bounding box + offset of the element.
code_block_13 = CodeBlock { "View Name"; }
setParameterByName = Element.SetParameterByName(element=byCoordinateSystemMinPointMaxPoint, parameterName=code_block_13, value=code_block_10)
code_block_14 = CodeBlock { SectionView; }
