# Dynamo graph Element View Generation Or.dyn (Dynamo 1.0.0.1180)

code_block = CodeBlock { "SectionA"; }
select_model_element = DSModelElementSelection()
select_model_elements = DSModelElementsSelection()  # 3 picked in the model
geometry = Element.Geometry(select_model_elements)
curves = Element.Curves(select_model_elements)
code_block_2 = CodeBlock { 0.5; }
pointAtParameter = Curve.PointAtParameter(curve=curves, param=code_block_2)

# group: STRUCTURAL FRAMING LOCAL AXIS DIRECTION
boolean = BoolSelector(false)
reverse = Curve.Reverse(curves)
# note: Reverse section views ?
if_ = If(test=boolean, true=reverse, false=curves)
direction = Line.Direction(if_)
code_block_3 = CodeBlock { 0; }
# note: Normal vector in local y-dir
normalAtParameter = Curve.NormalAtParameter(curve=if_, param=code_block_3)
code_block_4 = CodeBlock { -90; }
# note: Normal vector in local z-dir
rotate = Vector.Rotate(normalAtParameter, direction, code_block_4)

# group: VECTOR DEFINITION STRUCTURAL FRAMING
transpose = List.Transpose(direction)
flatten = Flatten(transpose)
transpose_2 = List.Transpose(rotate)
flatten_2 = Flatten(transpose_2)

# group: APPLY CS AND WORKPLANE
# note: Generate a plane at the solid center which is orientated to the view cs. This plane is used to detect the boundaries of the section view.
byOriginXAxisYAxis = Plane.ByOriginXAxisYAxis(pointAtParameter, flatten, flatten_2)
# note: Defines the coordinate system for the direction of the section view.
# This is taken in the centroid of the solid geometry to be able to define negative and positive values for the min/max point
# Top view:
# X=length axis element
# Y=normal at length axis
# Front view:
# X=length axis element
# Y=Global Z axis
# Cross section view:
# X=normal axis element
# Y=Global Z axis
byOriginVectors = CoordinateSystem.ByOriginVectors(origin=pointAtParameter, xAxis=flatten, yAxis=flatten_2, lacing=Longest)

# group: DETECT SECTION BOUNDARY CURVES AND WORKPOINTS
intersect = Geometry.Intersect(geometry=geometry, other=byOriginXAxisYAxis, lacing=Longest)
# note: Detect the perimeter curves of the cutting surface at the solid centroid
flatten_3 = Flatten(intersect)
# note: Get the single curves and their starting point to define the min and max boundary values
startPoint = Curve.StartPoint(flatten_3)

# group: TRANSLATE TO WCS FOR minPoint / maxPoint Calc
identity = CoordinateSystem.Identity()
transform = Geometry.Transform(contextCoordinateSystem=identity)
# note: As Point.X and Point.Y only work according to global WCS, the curves are transformed from the solid.centroid to the WCS in order to define the MinPoint and MaxPoint of the cut surface (offset values already included)
combine = List.Combine(transform, startPoint, byOriginVectors)
X = Point.X(combine)
maximumItem = List.MaximumItem(X)
Y = Point.Y(combine)
minimumItem = List.MinimumItem(Y)
maximumItem_2 = List.MaximumItem(Y)
minimumItem_2 = List.MinimumItem(X)

# group: BOUNDARY OFFSETS
offset_around_element_number = DoubleSlider(500, range=50..2000 step 100)  # "Offset around element / Number Slider"
view_depth_number_slider = DoubleSlider(1000, range=50..2000 step 100)

# group: INPUT VALUES
# note: X defines the length direction of the section view
# note: Y defines the width direction of the section view
# note: Distance between object countours and section crop region
code_block_5 = CodeBlock(CropRegionOffset=offset_around_element_number) { CropRegionOffset:double; }
code_block_6 = CodeBlock(ViewDepth=view_depth_number_slider) { ViewDepth:double; }
code_block_7 = CodeBlock { Viewname; }

view_depth_section = CodeBlock { 1000; }
code_block_8 = CodeBlock(a=view_depth_section) { a*-1; }
code_block_9 = CodeBlock { 0; }
byCoordinates = Point.ByCoordinates(x=minimumItem_2, y=code_block_8, z=code_block_9)
code_block_10 = CodeBlock(a=minimumItem_2) { a*-1; }
crop_region_plan = CodeBlock { 500; }
byCoordinates_2 = Point.ByCoordinates(x=code_block_10, y=view_depth_section, z=crop_region_plan)
code_block_11 = CodeBlock { "Section"; }
id = Element.Id(select_model_elements)
code_block_12 = CodeBlock(a=code_block_11, b=id) { a+b; }

# group: CREATE SECTION VIEW ACCORDING BOUNDING BOX
code_block_13 = CodeBlock(CropRegionOffset=code_block_5, ViewDepth=code_block_6)
# ---------- code_block_13.designscript (7 lines) ----------
//Z value calculation
//in accordance with the
//Centroid point
//Startingpoint of sectionview
-CropRegionOffset;
//Relative depth of sectionview
ViewDepth-CropRegionOffset;
# ----------------------------------------
byCoordinateSystemMinPointMaxPoint = SectionView.ByCoordinateSystemMinPointMaxPoint(byOriginVectors, byCoordinates, byCoordinates_2)
code_block_14 = CodeBlock { "View Name"; }
setParameterByName = Element.SetParameterByName(element=byCoordinateSystemMinPointMaxPoint, parameterName=code_block_14, value=code_block_12)

code_block_15 = CodeBlock(a=crop_region_plan) { a*-1; }
name = Element.Name(select_model_elements)
