# Dynamo graph Element View Generation Walls.dyn (Dynamo 0.9.1.4062)

# note: With this script it is possible to create automatically aligned section views on selected elements.
# In this script it is already set up for Structural Framing and Structural Columns.
# Necessary inputs are:
# Revit Elements: this to detect the solid.centroid. The views are oriented to that point
# X-vectors and Y-vectors to get the direction of the section plane. Traditionally these vectors are taken from the location lines of linear objects. You might replace this with a selected edge for instance.
# Authored by Dieter Vermeulen, Autodesk, 2015.
# http://revitbeyondbim.wordpress.com

boolean = BoolSelector(true)
wall_types = WallTypes("Generic - 200mm")
lunchbox_wall_element_collector = Custom[LunchBox Wall Element Collector](Toggle=boolean, Wall_Type=wall_types)  # Collects wall elements from the Revit document.

# group: STRUCTURAL FRAMING
identity = Object.Identity(lunchbox_wall_element_collector.Element)
location = StructuralFraming.Location(identity)
categories = Categories("StructuralFraming")
# note: Object.Identity as placeholder
# in case you want to change the input mode
all_elements_of_category = ElementsOfCategory(categories)

# group: STRUCTURAL FRAMING LOCAL AXIS DIRECTION
boolean_2 = BoolSelector(false)
reverse = Curve.Reverse(lunchbox_wall_element_collector.Location_Curve)
# note: Reverse section views ?
if_ = If(test=boolean_2, true=reverse, false=lunchbox_wall_element_collector.Location_Curve)
direction = Line.Direction(if_)
code_block = CodeBlock { 0; }
# note: Normal vector in local y-dir
normalAtParameter = Curve.NormalAtParameter(curve=if_, param=code_block)
# note: Normal vector in local z-dir
code_block_2 = CodeBlock { -90; }
rotate = Vector.Rotate(normalAtParameter, direction, code_block_2)

# group: VECTOR DEFINITION STRUCTURAL FRAMING
x_vector_list_create = List.Create(direction, normalAtParameter, direction)
transpose = List.Transpose(x_vector_list_create)
flatten = Flatten(transpose)
y_vector_list_create = List.Create(normalAtParameter, rotate, rotate)
transpose_2 = List.Transpose(y_vector_list_create)
flatten_2 = Flatten(transpose_2)

# group: STRUCTURAL COLUMN LOCAL AXIS DIRECTION
boolean_3 = BoolSelector(false)
reverse_2 = Curve.Reverse()
# note: Reverse section views ?
if_2 = If(test=boolean_3, true=reverse_2)
direction_2 = Line.Direction(if_2)
code_block_3 = CodeBlock { 0; }
# note: Normal vector in local y-dir. The vector needs correction in case of rotated cross sections, this angle is calculated with the Element.RotationAngle node
normalAtParameter_2 = Curve.NormalAtParameter(curve=if_2, param=code_block_3)
# note: Get the cross section rotation of the column. In case of slanted columns, the Element.RotationAngle node will return 'null'. This will be replaced afterwards with a 0 angle, as the normal angle can be detected correctly based on the location line direction.
rotationAngle = Custom[Element.RotationAngle]()  # Get the rotation element of a Revit element. The rotation angle is based on the Location.Rotation property in the RevitAPI. If Location is not equal to a LocationPoint (ie. in case of slanted columns) then the Angle will be set to null.
code_block_4 = CodeBlock { 0; }
code_block_5 = CodeBlock { null; }
eq = _ == code_block_5
replaceByCondition = Replace(rotationAngle, code_block_4, eq)
rotate_2 = Vector.Rotate(normalAtParameter_2, direction_2, replaceByCondition)
code_block_6 = CodeBlock { 90; }
# note: Normal vector in local z-dir
rotate_3 = Vector.Rotate(rotate_2, direction_2, code_block_6)

# group: VECTOR DEFINITION STRUCTURAL COLUMNS
x_vector_list_create_2 = List.Create(direction_2, rotate_2, direction_2)
transpose_3 = List.Transpose(x_vector_list_create_2)
flatten_3 = Flatten(transpose_3)
y_vector_list_create_2 = List.Create(rotate_2, rotate_3, rotate_3)
transpose_4 = List.Transpose(y_vector_list_create_2)
flatten_4 = Flatten(transpose_4)

join = List.Join(flatten, flatten_3)
join_2 = List.Join(flatten_2, flatten_4)

# group: BOUNDARY OFFSETS
offset_around_element_number = DoubleSlider(1050, range=50..2000 step 100)  # "Offset around element / Number Slider"
view_depth_number_slider = DoubleSlider(1000, range=50..2000 step 100)

# group: STRUCTURAL FRAMING ELEMENTS
code_block_7 = CodeBlock(lst=identity) { {lst}; }
count = List.Count(y_vector_list_create)
# note: Needs to be repeated "n" times. "n" is the number of types of sections. In this example : Front, Top, Cross (= 3x)
cycle = List.Cycle(list=code_block_7, amount=count)
transpose_5 = List.Transpose(cycle)
flatten_5 = Flatten(transpose_5)

# group: STRUCTURAL COLUMN ELEMENTS
code_block_8 = CodeBlock { {lst}; }
count_2 = List.Count(y_vector_list_create_2)
# note: Needs to be repeated "n" times. "n" is the number of types of sections. In this example : Front, Top, Cross (= 3x)
cycle_2 = List.Cycle(list=code_block_8, amount=count_2)
transpose_6 = List.Transpose(cycle_2)
flatten_6 = Flatten(transpose_6)

join_3 = List.Join(flatten_5, flatten_6)

# group: DEFINITION OF VIEW NAMES
code_block_9 = CodeBlock { "Mark"; }
getParameterValueByName = Element.GetParameterValueByName(element=identity, parameterName=code_block_9)
code_block_10 = CodeBlock(Suffix=getParameterValueByName) { "Top - " + Suffix; }
code_block_11 = CodeBlock(Suffix=getParameterValueByName) { "Cross - " + Suffix; }
code_block_12 = CodeBlock(Suffix=getParameterValueByName) { "Front - " + Suffix; }
y_vector_list_create_3 = List.Create(code_block_10, code_block_11, code_block_12)
transpose_7 = List.Transpose(y_vector_list_create_3)
flatten_7 = Flatten(transpose_7)

# group: DEFINITION OF VIEW NAMES
code_block_13 = CodeBlock { "Mark"; }
getParameterValueByName_2 = Element.GetParameterValueByName(parameterName=code_block_13)
code_block_14 = CodeBlock(Suffix=getParameterValueByName_2) { "Front - " + Suffix; }
code_block_15 = CodeBlock(Suffix=getParameterValueByName_2) { "Cross - " + Suffix; }
code_block_16 = CodeBlock(Suffix=getParameterValueByName_2) { "Side - " + Suffix; }
y_vector_list_create_4 = List.Create(code_block_14, code_block_15, code_block_16)
transpose_8 = List.Transpose(y_vector_list_create_4)
flatten_8 = Flatten(transpose_8)

join_4 = List.Join(flatten_7, flatten_8)
create_element_view = Custom[Create Element View](X_vector=join, Y_vector=join_2, CropRegionOffset=offset_around_element_number, ViewDepth=view_depth_number_slider, Revit_Elements=join_3, Viewname=join_4)
select_model_elements = DSModelElementsSelection()
location_2 = FamilyInstance.Location()
