# Dynamo graph Home.dyn (Dynamo 0.9.1.4062)

# note: With this script it is possible to create automatically aligned section views on selected elements.
# In this script it is already set up for Structural Framing and Structural Columns.
# Necessary inputs are:
# Revit Elements: this to detect the solid.centroid. The views are oriented to that point
# X-vectors and Y-vectors to get the direction of the section plane. Traditionally these vectors are taken from the location lines of linear objects. You might replace this with a selected edge for instance.
# Authored by Dieter Vermeulen, Autodesk, 2015.
# http://revitbeyondbim.wordpress.com

# group: STRUCTURAL FRAMING
categories = Categories("StructuralFraming")
# note: Object.Identity as placeholder
# in case you want to change the input mode
all_elements_of_category = ElementsOfCategory(categories)
identity = Object.Identity(all_elements_of_category)
location = StructuralFraming.Location(identity)

boolean = BoolSelector(true)
wall_types = WallTypes("Generic - 200mm")
lunchbox_wall_element_collector = Custom[LunchBox Wall Element Collector](Toggle=boolean, Wall_Type=wall_types)  # Collects wall elements from the Revit document.
flatten = Flatten(lunchbox_wall_element_collector.Location_Curve)

# group: STRUCTURAL FRAMING LOCAL AXIS DIRECTION
reverse = Curve.Reverse(location)
boolean_2 = BoolSelector(false)
# note: Reverse section views ?
if_ = If(test=boolean_2, true=location, false=flatten)
direction = Line.Direction(if_)
code_block = CodeBlock { 0; }
# note: Normal vector in local y-dir
normalAtParameter = Curve.NormalAtParameter(curve=if_, param=code_block)
code_block_2 = CodeBlock { -90; }
# note: Normal vector in local z-dir
rotate = Vector.Rotate(normalAtParameter, direction, code_block_2)

# group: VECTOR DEFINITION STRUCTURAL FRAMING
x_vector_list_create = List.Create(direction, normalAtParameter, direction)
transpose = List.Transpose(x_vector_list_create)
flatten_2 = Flatten(transpose)
y_vector_list_create = List.Create(normalAtParameter, rotate, rotate)
transpose_2 = List.Transpose(y_vector_list_create)
flatten_3 = Flatten(transpose_2)

# group: BOUNDARY OFFSETS
offset_around_element_number = DoubleSlider(500, range=50..2000 step 100)  # "Offset around element / Number Slider"
view_depth_number_slider = DoubleSlider(1000, range=50..2000 step 100)

# group: STRUCTURAL FRAMING ELEMENTS
code_block_3 = CodeBlock(lst=wall_types) { {lst}; }
count = List.Count(y_vector_list_create)
# note: Needs to be repeated "n" times. "n" is the number of types of sections. In this example : Front, Top, Cross (= 3x)
cycle = List.Cycle(list=code_block_3, amount=count)
transpose_3 = List.Transpose(cycle)
flatten_4 = Flatten(transpose_3)

# group: DEFINITION OF VIEW NAMES
code_block_4 = CodeBlock { "Mark"; }
getParameterValueByName = Element.GetParameterValueByName(element=lunchbox_wall_element_collector.Element, parameterName=code_block_4)
code_block_5 = CodeBlock(Suffix=getParameterValueByName) { "Top - " + Suffix; }
code_block_6 = CodeBlock(Suffix=getParameterValueByName) { "Cross - " + Suffix; }
code_block_7 = CodeBlock(Suffix=getParameterValueByName) { "Front - " + Suffix; }
y_vector_list_create_2 = List.Create(code_block_5, code_block_6, code_block_7)
transpose_4 = List.Transpose(y_vector_list_create_2)
flatten_5 = Flatten(transpose_4)

create_element_view = Custom[Create Element View](X_vector=flatten_2, Y_vector=flatten_3, CropRegionOffset=offset_around_element_number, ViewDepth=view_depth_number_slider, Revit_Elements=flatten_4, Viewname=flatten_5)
join = List.Join()
join_2 = List.Join()
join_3 = List.Join()
join_4 = List.Join()
select_model_elements = DSModelElementsSelection()
