# Dynamo graph Rotate section to line.dyn (Dynamo 1.0.0.1180)

code_block = CodeBlock { "SectionA"; }
select_model_elements = DSModelElementsSelection()  # 1 picked in the model
geometry = Element.Geometry(select_model_elements)
curves = Element.Curves(select_model_elements)
code_block_2 = CodeBlock { 0.5; }
pointAtParameter = Curve.PointAtParameter(curve=curves, param=code_block_2)

# group: STRUCTURAL FRAMING LOCAL AXIS DIRECTION
boolean = BoolSelector(false)
reverse = Curve.Reverse(curves)
# note: Reverse section views ?
if_ = If(test=boolean, true=reverse, false=curves)
direction = Line.Direction(if_)
code_block_3 = CodeBlock { 0; }
# note: Normal vector in local y-dir
normalAtParameter = Curve.NormalAtParameter(curve=if_, param=code_block_3)
code_block_4 = CodeBlock { -90; }
# note: Normal vector in local z-dir
rotate = Vector.Rotate(normalAtParameter, direction, code_block_4)

# group: VECTOR DEFINITION STRUCTURAL FRAMING
transpose = List.Transpose(direction)
flatten = Flatten(transpose)
transpose_2 = List.Transpose(rotate)
flatten_2 = Flatten(transpose_2)

# group: APPLY CS AND WORKPLANE
# note: Generate a plane at the solid center which is orientated to the view cs. This plane is used to detect the boundaries of the section view.
byOriginXAxisYAxis = Plane.ByOriginXAxisYAxis(pointAtParameter, flatten, flatten_2)
# note: Defines the coordinate system for the direction of the section view.
# This is taken in the centroid of the solid geometry to be able to define negative and positive values for the min/max point
# Top view:
# X=length axis element
# Y=normal at length axis
# Front view:
# X=length axis element
# Y=Global Z axis
# Cross section view:
# X=normal axis element
# Y=Global Z axis
byOriginVectors = CoordinateSystem.ByOriginVectors(origin=pointAtParameter, xAxis=flatten, yAxis=flatten_2, lacing=Longest)

# group: DETECT SECTION BOUNDARY CURVES AND WORKPOINTS
intersect = Geometry.Intersect(geometry=geometry, other=byOriginXAxisYAxis, lacing=Longest)
# note: Detect the perimeter curves of the cutting surface at the solid centroid
flatten_3 = Flatten(intersect)
# note: Get the single curves and their starting point to define the min and max boundary values
startPoint = Curve.StartPoint(flatten_3)

# group: TRANSLATE TO WCS FOR minPoint / maxPoint Calc
identity = CoordinateSystem.Identity()
transform = Geometry.Transform(contextCoordinateSystem=identity)
# note: As Point.X and Point.Y only work according to global WCS, the curves are transformed from the solid.centroid to the WCS in order to define the MinPoint and MaxPoint of the cut surface (offset values already included)
combine = List.Combine(transform, startPoint, byOriginVectors)
X = Point.X(combine)
maximumItem = List.MaximumItem(X)
Y = Point.Y(combine)
minimumItem = List.MinimumItem(Y)
maximumItem_2 = List.MaximumItem(Y)
minimumItem_2 = List.MinimumItem(X)

# group: BOUNDARY OFFSETS
offset_around_element_number = DoubleSlider(500, range=50..2000 step 100)  # "Offset around element / Number Slider"
view_depth_number_slider = DoubleSlider(1000, range=50..2000 step 100)

# group: INPUT VALUES
# note: X defines the length direction of the section view
# note: Y defines the width direction of the section view
# note: Distance between object countours and section crop region
code_block_5 = CodeBlock(CropRegionOffset=offset_around_element_number) { CropRegionOffset:double; }
code_block_6 = CodeBlock(ViewDepth=view_depth_number_slider) { ViewDepth:double; }
code_block_7 = CodeBlock { Viewname; }

# group: CREATE SECTION VIEW ACCORDING BOUNDING BOX
code_block_8 = CodeBlock(CropRegionOffset=code_block_5, ViewDepth=code_block_6)
# ---------- code_block_8.designscript (7 lines) ----------
//Z value calculation
//in accordance with the
//Centroid point
//Startingpoint of sectionview
-CropRegionOffset;
//Relative depth of sectionview
ViewDepth-CropRegionOffset;
# ----------------------------------------

crop_region_plan = CodeBlock { 500; }
code_block_9 = CodeBlock(a=crop_region_plan) { a*-1; }
views = Views("Section 1")
boundingBox = Element.BoundingBox(views)
python_script = Python()
# ---------- python_script.python (35 lines) ----------
import clr
clr.AddReference('RevitAPI')
from Autodesk.Revit.DB import *

clr.AddReference("RevitNodes")
import Revit
clr.ImportExtensions(Revit.GeometryConversion)
clr.ImportExtensions(Revit.Elements)

clr.AddReference("RevitServices")
import RevitServices
from RevitServices.Persistence import DocumentManager
from RevitServices.Transactions import TransactionManager

BBmin = UnwrapElement(IN[0])
BBmax = UnwrapElement(IN[1])

doc = DocumentManager.Instance.CurrentDBDocument
view = IN[2]
try:
	TransactionManager.Instance.EnsureInTransaction(doc)
	
	newmax = UnwrapElement(BB.MaxPoint).ToRevitType()
	newmin = UnwrapElement(BB.MinPoint).ToRevitType()
	newbox = BoundingBoxXYZ()
	newbox.Max = newmax
	newbox.Min = newmin
	
	view.SetSectionBox(newbox)
	
	TransactionManager.Instance.TransactionTaskDone()

	OUT = "Success!"
except:
	OUT = "Failed!"
# ----------------------------------------
code_block_10 = CodeBlock { Point.Origin(); Point.ByCoordinates(10,10,10); }
byCorners = BoundingBox.ByCorners(min=code_block_10.out0, max=code_block_10.out1)
watch = Watch()
byElements = Custom[Sectionbox.ByElements]()  # This node align a section box to the selected model elements. Requirements: active view must be a 3d view with section box enabled
koban = Python()
# ---------- koban.python (90 lines) ----------
import clr
clr.AddReference(‘ProtoGeometry’)
from Autodesk.DesignScript.Geometry import *

# Import ToDSType(bool) extension method
clr.AddReference(“RevitNodes”)
import Revit
clr.ImportExtensions(Revit.Elements)

# Import DocumentManager and TransactionManager
clr.AddReference(“RevitServices”)
import RevitServices
from RevitServices.Persistence import DocumentManager
from RevitServices.Transactions import TransactionManager

from System.Collections.Generic import *

# Import RevitAPI
clr.AddReference(“RevitAPI”)
import Autodesk
from Autodesk.Revit.DB import *

doc = DocumentManager.Instance.CurrentDBDocument
uiapp = DocumentManager.Instance.CurrentUIApplication
app = uiapp.Application

#The inputs to this node will be stored as a list in the IN variable.
dataEnteringNode = IN

linkElements = []
for i in IN[0]:
linkElements.append(UnwrapElement(i))

rvtLink = UnwrapElement(IN[1])
transform = rvtLink.GetTotalTransform()

elements = []
for i in IN[2]:
elements.append(UnwrapElement(i))

viewName = IN[3]

#get ViewFamilyType for a 3D View
collector = FilteredElementCollector(doc)
viewTypeColl = collector.OfClass(ViewFamilyType)
for i in viewTypeColl:
if i.ViewFamily == ViewFamily.ThreeDimensional:
viewType = i
else:
continue

# “Start” the transaction
TransactionManager.Instance.EnsureInTransaction(doc)

#define bounding box enclosing all elements
bboxMin, bboxMax = [], []
for i in linkElements:
bboxMin.append(transform.OfPoint(i.get_BoundingBox(doc.ActiveView).Min))
bboxMax.append(transform.OfPoint(i.get_BoundingBox(doc.ActiveView).Max))
for i in elements:
bboxMin.append(i.get_BoundingBox(doc.ActiveView).Min)
bboxMax.append(i.get_BoundingBox(doc.ActiveView).Max)
minX, minY, minZ, maxX, maxY, maxZ = [], [], [], [], [], []
for i, j in zip(bboxMin, bboxMax):
minX.append(i.X)
minY.append(i.Y)
minZ.append(i.Z)
maxX.append(j.X)
maxY.append(j.Y)
maxZ.append(j.Z)
bboxMinX = min(minX)
bboxMinY = min(minY)
bboxMinZ = min(minZ)
bboxMaxX = max(maxX)
bboxMaxY = max(maxY)
bboxMaxZ = max(maxZ)
#create a bounding box
bbox = BoundingBoxXYZ()
bbox.Min = XYZ((bboxMinX – 0.1), (bboxMinY – 0.1), (bboxMinZ – 0.1))
bbox.Max = XYZ((bboxMaxX + 0.1), (bboxMaxY + 0.1), (bboxMaxZ + 0.1))
#create 3d View
view = View3D.CreateIsometric(doc, viewType.Id)
view.Name = viewName
view.SectionBox = bbox

# “End” the transaction
TransactionManager.Instance.TransactionTaskDone()

#Assign your output to the OUT variable
OUT = 0
# ----------------------------------------
view_depth_section = CodeBlock { 1000; }
code_block_11 = CodeBlock(a=view_depth_section) { a*-1; }
code_block_12 = CodeBlock { 0; }
byCoordinates = Point.ByCoordinates(x=minimumItem_2, y=code_block_11, z=code_block_12)
code_block_13 = CodeBlock(a=minimumItem_2) { a*-1; }
byCoordinates_2 = Point.ByCoordinates(x=code_block_13, y=view_depth_section, z=crop_region_plan)
python_script_2 = Python(IN[0]=byCoordinates, IN[1]=byCoordinates_2)
# ---------- python_script_2.python (30 lines) ----------
import clr
clr.AddReference('RevitAPI')
from Autodesk.Revit.DB import *

clr.AddReference("RevitNodes")
import Revit
clr.ImportExtensions(Revit.GeometryConversion)
clr.ImportExtensions(Revit.Elements)

clr.AddReference("RevitServices")
import RevitServices
from RevitServices.Persistence import DocumentManager
from RevitServices.Transactions import TransactionManager

BBmin = IN[0]
BBmax = IN[1]

try:
	TransactionManager.Instance.EnsureInTransaction(doc)
	
	newbox = BoundingBoxXYZ()
	newbox.Max = BBmax
	newbox.Min = BBmin
	
	
	TransactionManager.Instance.TransactionTaskDone()

	OUT = [BBmin]
except:
	OUT = "Failed!"
# ----------------------------------------
boundingBox_2 = Element.BoundingBox()
code_block_14 = CodeBlock { Offset; }
code_block_15 = CodeBlock { -1; }
mul = code_block_14 * code_block_15
code_block_16 = CodeBlock(bbox=boundingBox_2, b=mul)
# ---------- code_block_16.designscript (7 lines) ----------
a=bbox.MinPoint;
xmin=List.MinimumItem(a.X);
ymin=List.MinimumItem(a.Y);
zmin=List.MinimumItem(a.Z);
offset=b;

Point.ByCoordinates(xmin+b,ymin+b,zmin+b);
# ----------------------------------------
code_block_17 = CodeBlock(bbox=boundingBox_2, b=code_block_14)
# ---------- code_block_17.designscript (7 lines) ----------
a=bbox.MaxPoint;
xmax=List.MaximumItem(a.X);
ymax=List.MaximumItem(a.Y);
zmax=List.MaximumItem(a.Z);
offset=b;

Point.ByCoordinates(xmax+b,ymax+b,zmax+b);
# ----------------------------------------
byCorners_2 = BoundingBox.ByCorners(min=code_block_16.out5, max=code_block_17.out5)
python_script_3 = Python(IN[0]=byCorners_2)
# ---------- python_script_3.python (37 lines) ----------
import clr
clr.AddReference('RevitAPI')
from Autodesk.Revit.DB import *

clr.AddReference('RevitNodes') 
import Revit
clr.ImportExtensions(Revit.GeometryConversion)
clr.ImportExtensions(Revit.Elements)

clr.AddReference('RevitServices') 
import RevitServices
from RevitServices.Persistence import DocumentManager
from RevitServices.Transactions import TransactionManager

#The inputs to this node will be stored as a list in the IN variable.
dataEnteringNode = IN

bbox=IN[0]

doc=DocumentManager.Instance.CurrentDBDocument
myview=doc.ActiveView
try:
	TransactionManager.Instance.EnsureInTransaction(doc)
	
	newmax=UnwrapElement(bbox.MaxPoint).ToRevitType()
	newmin=UnwrapElement(bbox.MinPoint).ToRevitType()
	newbox=BoundingBoxXYZ()
	newbox.Max=newmax
	newbox.Min=newmin
	
	z=myview.SetSectionBox(newbox)
	
	TransactionManager.Instance.TransactionTaskDone()
	
	OUT = "Success!"
except:
	OUT="Failed miserably..."
# ----------------------------------------
byCorners_3 = BoundingBox.ByCorners(min=byCoordinates, max=byCoordinates_2)
views_2 = Views("Section 1")
python_script_4 = Python(IN[0]=byCorners_3, IN[1]=views_2)
# ---------- python_script_4.python (37 lines) ----------
import clr
clr.AddReference('RevitAPI')
from Autodesk.Revit.DB import *

clr.AddReference('RevitNodes') 
import Revit
clr.ImportExtensions(Revit.GeometryConversion)
clr.ImportExtensions(Revit.Elements)

clr.AddReference('RevitServices') 
import RevitServices
from RevitServices.Persistence import DocumentManager
from RevitServices.Transactions import TransactionManager

#The inputs to this node will be stored as a list in the IN variable.
dataEnteringNode = IN

bbox=IN[0]

doc=DocumentManager.Instance.CurrentDBDocument
myview=UnwrapElement(IN[1]) 
try:
	TransactionManager.Instance.EnsureInTransaction(doc)
	
	newmax=UnwrapElement(bbox.MaxPoint).ToRevitType()
	newmin=UnwrapElement(bbox.MinPoint).ToRevitType()
	newbox=BoundingBoxXYZ()
	newbox.Max=newmax
	newbox.Min=newmin
	
	z=myview.SetSectionBox(newbox)
	
	TransactionManager.Instance.TransactionTaskDone()
	
	OUT = "Success!"
except:
	OUT="Failed miserably..."
# ----------------------------------------
byBoundingBox = SectionView.ByBoundingBox()
byCoordinateSystemMinPointMaxPoint = SectionView.ByCoordinateSystemMinPointMaxPoint()
