# Dynamo graph section.dyn (Dynamo 0.9.1.4062)

select_model_element = DSModelElementSelection()  # 1 picked in the model
select_model_elements = DSModelElementsSelection()  # 4 picked in the model
boundingBox = Geometry.BoundingBox(select_model_elements)
byBoundingBox = SectionView.ByBoundingBox(boundingBox)
