# Dynamo graph Excel to Dynamo Formula.dyn (Dynamo 1.2.3.592)

# group: Selecting Revit Data to export to Excel
categories = Categories("Rooms")
all_elements_of_category = ElementsOfCategory(categories)
code_block = CodeBlock { {"Volume"}; }
getParameterValueByName = Element.GetParameterValueByName(element=all_elements_of_category, parameterName=code_block, lacing=CrossProduct)

min_ach_for_fresh_air = CodeBlock { 4; }
total_ach_vent = Custom[Total ACH Vent](Volume=getParameterValueByName, Min_ACH_for_fresh_air=min_ach_for_fresh_air)
sensible_cooling_load = Custom[Total sensible cooling load]()  # unwired: People_sensible, Occupancy_Round_up, Lighting, Equipment, Solar, Infiltration, External_Fabric_Conduction, Ventilation_Gain
file_path = Filename("..\Lesson%204\HVAC%20Workbook.xlsx")
code_block_2 = CodeBlock { "Text"; }
code_block_3 = CodeBlock { 0; }
fromPath = FileObject(file_path)  # "File.FromPath"
code_block_4 = CodeBlock { "Cooling Loads"; }
code_block_5 = CodeBlock { 1; }
readFromFile = Excel.ReadFromFile(file=fromPath, sheetName=code_block_4, readAsStrings=code_block_5)
code_block_6 = CodeBlock(a=readFromFile) { a[5]; }
code_block_7 = CodeBlock { "Alphabet"; }
code_block_8 = CodeBlock { 1; }
readFromFile_2 = Excel.ReadFromFile(file=fromPath, sheetName=code_block_7, readAsStrings=code_block_8)
transpose = List.Transpose(readFromFile_2)
code_block_9 = CodeBlock(a=transpose) { a[4]; }
string = StringInput("Y9*O9*AA9*G9*AB9*G9*AC9*AD9*AF9*AG9*AI9")
code_block_10 = CodeBlock { "*"; }
split = String.Split(string, code_block_10)
code_block_11 = CodeBlock { "9"; }
code_block_12 = CodeBlock { ""; }
replace = String.Replace(str=split, searchFor=code_block_11, replaceWith=code_block_12)
allIndicesOf = List.AllIndicesOf(list=code_block_9, item=replace)
getItemAtIndex = List.GetItemAtIndex(list=code_block_6, index=allIndicesOf)
code_block_13 = CodeBlock(a=getItemAtIndex) { Flatten(a); }
writeToFile = Excel.WriteToFile(filePath=file_path, sheetName=code_block_2, startRow=code_block_3, startCol=code_block_3, data=code_block_13)
code_block_14 = CodeBlock { ((Y9*O9)+(AA9*G9)+(AB9*G9)+AC9+AD9+AF9+AG9+AI9)/1000; }  # unwired: Y9, O9, AA9, G9, AB9, AC9, AD9, AF9, AG9, AI9
