# Dynamo graph ExportToRhino.dyn (Dynamo 1.3.1.1736)

file_path = Filename("C:\Users\giovanni.brogiolo\Desktop\test.3dm")
boolean = BoolSelector(true)
select_model_element = DSModelElementSelection()  # 1 picked in the model
geometry = Element.Geometry(select_model_element)
explode = Geometry.Explode(geometry)
DS_NurbsSurfaceToRhino = Interoperability.WriteRhino.CreateRhinoGeometry.DS_NurbsSurfaceToRhino(explode)
code_block = CodeBlock { "Floor"; }
code_block_2 = CodeBlock { 255; 0; }
create_RhinoColor = Interoperability.WriteRhino.CreateRhinoObjects.Create_RhinoColor(code_block_2.out0, code_block_2.out1, code_block_2.out1)
code_block_3 = CodeBlock { "export"; }
create_RhinoLayer = Interoperability.WriteRhino.CreateRhinoObjects.Create_RhinoLayer(code_block_3, create_RhinoColor)
create_RhinoObject = Interoperability.WriteRhino.CreateRhinoObjects.Create_RhinoObject(DS_NurbsSurfaceToRhino, code_block, create_RhinoColor, create_RhinoLayer)
code_block_4 = CodeBlock { "millimeters"; }
save_Rhino3dmModel = Interoperability.WriteRhino.SaveRhino3dmModel.Save_Rhino3dmModel(file_path, boolean, create_RhinoObject, code_block_4, lacing=Longest)
