# Dynamo graph IFC Exporter.dyn (Dynamo 1.3.1.1736)

file_path = Filename("..\Desktop\IfcTest2.ifc")
code_block = CodeBlock { "\n"; }
code_block_2 = CodeBlock { "ENDSEC; END-ISO-10303-21; "; }
code_block_3 = CodeBlock()
# ---------- code_block_3.designscript (18 lines) ----------
"ISO-10303-21;
HEADER;
FILE_DESCRIPTION(('ViewDefinition [notYetAssigned]'),'2;
1');
FILE_NAME(
/* name */ 'C:\\Users\\giovanni.brogiolo\\Documents\\GeometryGymIFCExamples\\ConsoleParametricFooting\\ParametricFooting.ifc',
/* time_stamp */ '2017-09-06T13:36:04',
/* author */ ('giovanni.brogiolo'),
/* organization */ ('Unknown'),
/* preprocessor_version */ 'GeometryGymIFC v0.0.15.0 by Geometry Gym Pty Ltd built 2017-07-28T01:17:24',
/* originating_system */ 'ConsoleParametricFooting v1.0.0.0',
/* authorization */ 'None');

FILE_SCHEMA (('IFC4'));
ENDSEC;

DATA;
";
# ----------------------------------------
code_block_4 = CodeBlock()
# ---------- code_block_4.designscript (53 lines) ----------
"
using System;
using System.Collections.Generic;
using System.Linq;
using System.Text;
using System.Threading.Tasks;
using GeometryGym.Ifc;
using Autodesk.DesignScript.Geometry;

public static DatabaseIfc Dict(Point Pt)
 {
   double len = 5000;
   string mpsNames = \"mspNames\";
   List<Plane> clipPlanes = new List<Plane>();
   string PName = \"IPE\";
   DatabaseIfc db = new DatabaseIfc(ModelView.Ifc4DesignTransfer
   );
   IfcBuilding building = new IfcBuilding(db, \"IfcBuilding\"
   );
   IfcProject project = new IfcProject(building,
   \"IfcProject\",
   IfcUnitAssignment.Length.Millimetre
   );
   IfcMaterial s355 = new IfcMaterial(db,\"S355JR\");

   IfcIShapeProfileDef pd = new IfcIShapeProfileDef(
   db,PName,300,150,7.1,10.7,15);

   IfcMaterialProfile mp = new IfcMaterialProfile(PName, s355, pd);

   IfcMaterialProfileSet mps = new IfcMaterialProfileSet(mpsNames,mp);

   IfcMaterialProfileSetUsage mpu = new IfcMaterialProfileSetUsage(
   mps,IfcCardinalPointReference.MID);

   IfcCartesianPoint ifcPoint = new IfcCartesianPoint(db, Pt.X,Pt.Y,Pt.Z);

   IfcAxis2Placement3D axis = new IfcAxis2Placement3D(ifcPoint);

   IfcBeamStandardCase beam = new IfcBeamStandardCase(
    building,
    mpu,
    axis,
    len);

   return db;
 }


Point Pt = IN[0] as Point;

Dict(Pt)
   ";
# ----------------------------------------
code_block_5 = CodeBlock { Autodesk.Point.ByCoordinates(0,0,0); }
file_path_2 = Filename("C:\Users\giovanni.brogiolo\Documents\GeometryGymIFCExamples\packages\GeometryGymIFC.0.0.15\lib\net45\GeometryGymIFC.dll")
fromString = Scripting.CSharpScript.FromString(code_block_4, code_block_5, file_path_2, lacing=Longest)
deconstruct = List.Deconstruct(list=fromString)
string_from_object = FromObject(deconstruct.rest)
addItemToFront = List.AddItemToFront(item=code_block_3, list=string_from_object)
addItemToEnd = List.AddItemToEnd(item=code_block_2, list=addItemToFront)
join = String.Join(code_block, addItemToEnd)
writeText = File.WriteText(file_path, join, lacing=Longest)
