# Dynamo graph PDFlink.dyn (Dynamo 1.3.1.1736)

family_types = FamilyTypes("Arup_Rev Issue Box_BS1192_v1:Revision Data")
all_elements_of_family_type = ElementsOfFamilyType(family_types)
deconstruct = List.Deconstruct(list=all_elements_of_family_type)
ownerView = Custom[Element.OwnerView](element=deconstruct.rest)  # Gets the owner view of a given Revit element (if possible)
sheetNumber = Sheet.SheetNumber(ownerView)
code_block = CodeBlock { 101..104; }
string_from_object = FromObject(code_block)
code_block_2 = CodeBlock(a=string_from_object) { "S-"+a; }
allIndicesOf = List.AllIndicesOf(list=sheetNumber, item=code_block_2)
getItemAtIndex = List.GetItemAtIndex(list=deconstruct.rest, index=allIndicesOf)
code_block_3 = CodeBlock { "PDF Link"; }
setParameterByName = Element.SetParameterByName(element=getItemAtIndex, parameterName=code_block_3)  # unwired: value
string = StringInput("\\Global.arup.com\london\BEL\Jobs\200000\235900\235972-00 Wedge House\4 Internal Data\03 Drawings\07 Structural\03 Exports\01 PDF")
fromPath = DirectoryObject(string)  # "Directory.FromPath"
contents = Directory.Contents(fromPath)
string_2 = StringInput("\")
split = String.Split(contents.out1, string_2)
code_block_4 = CodeBlock { 12; }
getItemAtIndex_2 = List.GetItemAtIndex(list=split, index=code_block_4, lacing=Longest)
string_3 = StringInput(" ")
split_2 = String.Split(getItemAtIndex_2, string_3)
code_block_5 = CodeBlock { 0; }
getItemAtIndex_3 = List.GetItemAtIndex(list=split_2, index=code_block_5, lacing=Longest)
code_block_6 = CodeBlock { "Date"; }
getParameterValueByName = Element.GetParameterValueByName(element=deconstruct.rest, parameterName=code_block_6)
deconstruct_2 = List.Deconstruct(list=getParameterValueByName)
code_block_7 = CodeBlock(a=deconstruct_2.rest) { a; }
code_block_8 = CodeBlock { "."; }
split_3 = String.Split(code_block_7, code_block_8)
code_block_9 = CodeBlock { 2; }
getItemAtIndex_4 = List.GetItemAtIndex(list=split_3, index=code_block_9, lacing=Longest)
code_block_10 = CodeBlock { 1; }
getItemAtIndex_5 = List.GetItemAtIndex(list=split_3, index=code_block_10, lacing=Longest)
code_block_11 = CodeBlock { 0; }
getItemAtIndex_6 = List.GetItemAtIndex(list=split_3, index=code_block_11, lacing=Longest)
code_block_12 = CodeBlock(year=getItemAtIndex_4, month=getItemAtIndex_5, day=getItemAtIndex_6) { "20"+year+"-"+month+"-"+day; }
allIndicesOf_2 = List.AllIndicesOf(list=getItemAtIndex_3, item=code_block_12)
getItemAtIndex_7 = List.GetItemAtIndex(list=contents.out1, index=allIndicesOf_2)
code_block_13 = CodeBlock { 0; }
getItemAtIndex_8 = List.GetItemAtIndex(list=getItemAtIndex_7, index=code_block_13, lacing=Longest)
string_4 = StringInput("\")
code_block_14 = CodeBlock(path=getItemAtIndex_8, sep=string_4, ShName=sheetNumber) { path+sep+ShName+"_.pdf"; }
code_block_15 = CodeBlock(a=deconstruct.rest) { a; }

# group: NOT GREAT
string_5 = StringInput("\\Global.arup.com\london\BEL\Jobs\200000\235900\235972-00 Wedge House\4 Internal Data\01 Outgoing Documents Register")
file_list_from_file_path_showing = Custom[File List from File Path showing Files in SubDirs](DirectoryPath=string_5)
file_list_from_file_path_showing_2 = Custom[File List from File Path showing Files in SubDirs](DirectoryPath=file_list_from_file_path_showing.directoryList)
file_list_from_file_path = Custom[File List from File Path](DirectoryPath=file_list_from_file_path_showing.directoryList)
code_block_16 = CodeBlock { ".pdf"; }
all_directory_contents_of = Custom[All Directory Contents of Specific Filetype](dir_string=string_5, file_extension_string_like_txt=code_block_16)  # from clockwork
string_6 = StringInput("\")
split_4 = String.Split(all_directory_contents_of, string_6)
code_block_17 = CodeBlock { 11; }
getItemAtIndex_9 = List.GetItemAtIndex(list=split_4, index=code_block_17, lacing=Longest)
code_block_18 = CodeBlock { "-"; }
split_5 = String.Split(getItemAtIndex_9, code_block_18)
code_block_19 = CodeBlock { 1; }
getItemAtIndex_10 = List.GetItemAtIndex(list=split_5, index=code_block_19, lacing=Longest)
code_block_20 = CodeBlock { "."; }
split_6 = String.Split(getItemAtIndex_10, code_block_20)
code_block_21 = CodeBlock { 0; }
getItemAtIndex_11 = List.GetItemAtIndex(list=split_6, index=code_block_21, lacing=Longest)
code_block_22 = CodeBlock(a=getItemAtIndex_11) { a==null; }
code_block_23 = CodeBlock { "nullo"; }
if_ = If(test=code_block_22, true=code_block_23, false=getItemAtIndex_11)

allIndicesOf_3 = List.AllIndicesOf()  # unwired: list, item
getItemAtIndex_12 = List.GetItemAtIndex(list=all_directory_contents_of, index=allIndicesOf_3)
string_7 = StringInput("\\Global.arup.com\london\BEL\Jobs\200000\235900\235972-00 Wedge House\4 Internal Data\01 Outgoing Documents Register")
code_block_24 = CodeBlock(a=code_block_2) { "*"+a+"*.pdf"; }
contents_2 = Custom[Directory.Contents+](directoryPath=string_7, searchString=code_block_24)  # Unlike the built-in node Directory.Contents, this node browses a directory recursively and returns all relevant files contained in subfolders as well.
get_date_modified_from_file_path = Custom[Get Date Modified From File Path List](filePathList=contents_2, lacing=Longest)  # list of paths to files
string_from_object_2 = FromObject(get_date_modified_from_file_path)
fromString = DateTime.FromString(string_from_object_2)
code_block_25 = CodeBlock { "yyyy-MM-d"; }

# group: pdf date
format = DateTime.Format(fromString, code_block_25)

code_block_26 = CodeBlock { 7; }
get_characters_at_start_of = Custom[Get Characters at Start of Strings](listOfStrings=format, charactersToKeep=code_block_26)
getParameterValueByName_2 = Element.GetParameterValueByName(element=getItemAtIndex, parameterName=code_block_6)
code_block_27 = CodeBlock(a=getParameterValueByName_2) { a; }
split_7 = String.Split(code_block_27, code_block_8)
code_block_28 = CodeBlock { 2; }
getItemAtIndex_13 = List.GetItemAtIndex(list=split_7, index=code_block_28, lacing=Longest)
code_block_29 = CodeBlock(year=getItemAtIndex_13) { "20"+year; }
toNumber = String.ToNumber(code_block_29)
code_block_30 = CodeBlock { 1; }
getItemAtIndex_14 = List.GetItemAtIndex(list=split_7, index=code_block_30, lacing=Longest)
toNumber_2 = String.ToNumber(getItemAtIndex_14)
code_block_31 = CodeBlock { 0; }
getItemAtIndex_15 = List.GetItemAtIndex(list=split_7, index=code_block_31, lacing=Longest)
toNumber_3 = String.ToNumber(getItemAtIndex_15)
byDate = DateTime.ByDate(toNumber, toNumber_2, toNumber_3)

# group: revision date
format_2 = DateTime.Format(byDate, code_block_25)

get_characters_at_start_of_2 = Custom[Get Characters at Start of Strings](listOfStrings=format_2, charactersToKeep=code_block_26)
allIndicesOf_4 = List.AllIndicesOf(list=get_characters_at_start_of, item=get_characters_at_start_of_2)
allIndicesOf_5 = List.AllIndicesOf(list=format, item=format_2, lacing=Longest)
isEmpty = List.IsEmpty(allIndicesOf_5, lacing=Longest)
filterByBoolMask = List.FilterByBoolMask(list=allIndicesOf_4, mask=isEmpty)
code_block_32 = CodeBlock { 0; }
getItemAtIndex_16 = List.GetItemAtIndex(list=allIndicesOf_4, index=code_block_32, lacing=Longest)
code_block_33 = CodeBlock { 0; }
getItemAtIndex_17 = List.GetItemAtIndex(list=allIndicesOf_5, index=code_block_33, lacing=Longest)
if_2 = If(test=isEmpty, true=getItemAtIndex_16, false=getItemAtIndex_17)
getItemAtIndex_18 = List.GetItemAtIndex(list=contents_2, index=if_2)

# group: drawing to find
string_8 = StringInput("101")
