# Dynamo graph pdfSet.dyn (Dynamo 1.3.1.1736)

string = StringInput("M-BAR-1F4TS0-CB00-EDR-(.*)")
file_path = Filename("C:\Users\giovanni.brogiolo\Desktop\2017-11-24_TK lift comments and more.txt")
readText = File.ReadText(file_path)
findRegularExpression = Custom[String.FindRegularExpression](RegEx=string, str=readText)  # Returns all occurences of a regular expression within a string (or list of strings). The syntax for regular expressions is explained at http://ironpython-test.readthedocs.org/en/latest/howto/regex.html
code_block = CodeBlock(a=findRegularExpression) { DSCore.String.Length(a)==7; }
filterByBoolMask = List.FilterByBoolMask(list=findRegularExpression, mask=code_block)
