# Dynamo graph pdfSet_v08.dyn (Dynamo 0.8.2.2392)

categories = Categories("TitleBlocks")
all_elements_of_category = ElementsOfCategory(categories)
code_block = CodeBlock { "Sheet Number"; }
getParameterValueByName = Element.GetParameterValueByName(element=all_elements_of_category, parameterName=code_block)
python_script = Python(IN[0]=getParameterValueByName)
# ---------- python_script.python (11 lines) ----------
import clr
clr.AddReference('ProtoGeometry')
from Autodesk.DesignScript.Geometry import *
#The inputs to this node will be stored as a list in the IN variables.
dataEnteringNode = IN
type = []
for p in IN[0]:
	type.append(p.GetType())

#Assign your output to the OUT variable.
OUT = type
# ----------------------------------------
code_block_2 = CodeBlock { "Sheet Issue Date"; }
code_block_3 = CodeBlock { "2017 December 15"; }
setParameterByName = Element.SetParameterByName(parameterName=code_block_2, value=code_block_3, lacing=Longest)
categories_2 = Categories("RevisionClouds")
all_elements_of_category_2 = ElementsOfCategory(categories_2)
ownerView = Custom[Element.OwnerView](element=all_elements_of_category_2)  # Gets the owner view of a given Revit element (if possible)
code_block_4 = CodeBlock { "Sheet Number"; }
getParameterValueByName_2 = Element.GetParameterValueByName(element=ownerView, parameterName=code_block_4)
string = StringInput("M-BAR-1F4TS0-CB00-EDR-(.*)")
string_2 = StringInput("C:\Users\giovanni.brogiolo\Desktop\2017-11-24_TK lift comments and more.txt")
readText = File.ReadText(string_2)
findRegularExpression = Custom[String.FindRegularExpression](RegEx=string, str=readText)  # Returns all occurences of a regular expression within a string (or list of strings). The syntax for regular expressions is explained at http://ironpython-test.readthedocs.org/en/latest/howto/regex.html
uniqueItems = List.UniqueItems(findRegularExpression)
code_block_5 = CodeBlock(t3=uniqueItems)
# ---------- code_block_5.designscript (8 lines) ----------
drawingNumbers = String.ToNumber(t3);
drawingNumbers = String.ToNumber(t3);
drawingNumbers = String.ToNumber(t3);
a = drawingNumbers;
t1 = a > 1000;
boolMask = List.FilterByBoolMask(t3, t1);
t4 = __TryGetValueFromNestedDictionaries(boolMask, "in");
t5 = __TryGetValueFromNestedDictionaries(boolMask, "out");
# ----------------------------------------
code_block_6 = CodeBlock(a=code_block_5.out4) { a; }
trimWhitespace = String.TrimWhitespace(code_block_6)
allIndicesOf = List.AllIndicesOf(list=getParameterValueByName_2, item=trimWhitespace)
flatten = Flatten(allIndicesOf)
getItemAtIndex = List.GetItemAtIndex(list=all_elements_of_category_2, index=flatten)
code_block_7 = CodeBlock { "Revision Date"; }
getParameterValueByName_3 = Element.GetParameterValueByName(element=getItemAtIndex, parameterName=code_block_7)
code_block_8 = CodeBlock { "15/12/2017"; }
contains = String.Contains(str=getParameterValueByName_3, searchFor=code_block_8)

# group: Clouds
filterByBoolMask = List.FilterByBoolMask(list=getItemAtIndex, mask=contains)

# group: CLOUDS
code_block_9 = CodeBlock(a=filterByBoolMask.in) { a; }

ownerView_2 = Custom[Element.OwnerView](element=code_block_9)
sheetNumber = Sheet.SheetNumber(ownerView_2)
allIndicesOf_2 = List.AllIndicesOf(list=getParameterValueByName, item=trimWhitespace)
flatten_2 = Flatten(allIndicesOf_2)
getItemAtIndex_2 = List.GetItemAtIndex(list=all_elements_of_category, index=flatten_2)
code_block_10 = CodeBlock(a=getItemAtIndex_2) { a; }
setParameterByName_2 = Element.SetParameterByName(element=code_block_9)
code_block_11 = CodeBlock { {"Comments","Mark"}; }
code_block_12 = CodeBlock { {"TB_Revision","TB_Version"}; }
getParameterValueByName_4 = Element.GetParameterValueByName(element=ownerView_2, parameterName=code_block_12, lacing=CrossProduct)
code_block_13 = CodeBlock { "v"; }
code_block_14 = CodeBlock { ""; }
replace = String.Replace(str=getParameterValueByName_4, searchFor=code_block_13, replaceWith=code_block_14)
transpose = List.Transpose(replace)
combine = List.Combine(setParameterByName_2, code_block_11, transpose)
