# Dynamo graph Balaustrade.dyn (Dynamo 1.2.0.2514)

# group: INPUT: IN PLACE MASS
select_model_element = DSModelElementSelection()  # 1 picked in the model

faces = Element.Faces(select_model_element)
filterByOrientation = Custom[Surface.FilterByOrientation](surfaces=faces)  # Sorts surfaces in three lists based on their orientation (vertical, horizontal up & horizontal down) and also returns three corresponding lists of booleans.
wall_types = WallTypes("Wall 1")
finishFaceExterior = Custom[WallLocationLine.FinishFaceExterior]()  # Returns the WallLocationLine option for FinishFaceExterior
watch = Watch(faces)

# group: Revit Reference-Clockwork
python_script = Python(IN[0]=watch)
# ---------- python_script.python (13 lines) ----------
import clr
clr.AddReference('RevitAPI')
from Autodesk.Revit.DB import *

faces = UnwrapElement(IN[0])
elementlist = list()
for face in faces:
	try:
		ref = face.Tags.LookupTag("RevitFaceReference")
		elementlist.append(ref)
	except:
		elementlist.append(list())
OUT = elementlist
# ----------------------------------------

# group: Wall by Face - Clockwork
python_script_2 = Python(IN[0]=wall_types, IN[1]=finishFaceExterior.FinishFaceExterior, IN[2]=python_script)
# ---------- python_script_2.python (28 lines) ----------
import clr
clr.AddReference('RevitAPI')
from Autodesk.Revit.DB import *

clr.AddReference("RevitNodes")
import Revit
clr.ImportExtensions(Revit.Elements)

clr.AddReference("RevitServices")
import RevitServices
from RevitServices.Persistence import DocumentManager
from RevitServices.Transactions import TransactionManager

doc = DocumentManager.Instance.CurrentDBDocument
walltype = UnwrapElement(IN[0])
locline = IN[1]
facerefs = IN[2]
elementlist = list()

TransactionManager.Instance.EnsureInTransaction(doc)
for ref in facerefs:
	try:
		newwall = FaceWall.Create(doc,walltype.Id,locline,ref)
		elementlist.append(newwall)
	except:
		elementlist.append(list())
TransactionManager.Instance.TransactionTaskDone()
OUT = elementlist
# ----------------------------------------
