# Dynamo graph Beam in family.dyn (Dynamo 0.8.2.2392)

family_types = FamilyTypes("STR_UKB-UK Beams:UKB457x191x133 +")
code_block = CodeBlock { 1..5000..500; }
byCoordinates = FamilyInstance.ByCoordinates(family_types, arg2=code_block)
code_block_2 = CodeBlock { 45; }
setRotation = FamilyInstance.SetRotation(familyInstance=byCoordinates, degree=code_block_2)
byGeometry = Custom[FamilyInstance.ByGeometry]()  # You must provide a valid family template path that will be used for all input geometry objects. The project units(and not the templates) will be used to determine the size of the output geometry. The provided category will be used only if the family template supports it. If not, the default template category will be used instead. Likewise, the family material(provided as a string) will be set only if a material with that name exists in the template. If not, the default material will be used instead ("By Category"). For void cuts, the material settings will be ignored. The Subcategory name is an optional input. If you'd like to skip assigning a Subcategory to any new instance, simply use null. The node expects a unique family name for each geometry object. The rest of the input lists will be processed as if the node lacing is set to longest.
