# Dynamo graph familyIsInPlace.dyn (Dynamo 1.3.1.1736)

select_model_elements = DSModelElementsSelection()  # 6 picked in the model
python_script = Python(IN[0]=select_model_elements)
# ---------- python_script.python (31 lines) ----------
import clr
clr.AddReference("ProtoGeometry")
from Autodesk.DesignScript.Geometry import *
# Import RevitAPI
clr.AddReference("RevitAPI")
from Autodesk.Revit.DB import *
clr.AddReference("RevitAPIUI")
from Autodesk.Revit.UI import TaskDialog
# Import DocumentManager and TransactionManager
clr.AddReference("RevitServices")
from RevitServices.Persistence import DocumentManager
from RevitServices.Transactions import TransactionManager
# Import ToProtoType, ToRevitType geometry conversion extension methods
clr.AddReference("RevitNodes")
import Revit
clr.ImportExtensions(Revit.GeometryConversion)


list = IN[0]

family = []

for l in list:
	try:
		a = l.GetFamily
		family.append(l)
	except:
		None

#Assign your output to the OUT variable.
OUT = family
# ----------------------------------------
isInPlace = WombatDynamo.FamilyInstance.IsInPlace(python_script, lacing=Longest)
family_types = FamilyTypes("Generic Models 1:Generic Models 1")
family = FamilyType.Family(family_types)
python_script_2 = Python(IN[0]=family)
# ---------- python_script_2.python (10 lines) ----------
import clr
clr.AddReference('ProtoGeometry')
from Autodesk.DesignScript.Geometry import *
#The inputs to this node will be stored as a list in the IN variables.
dataEnteringNode = IN

list = IN[0]

#Assign your output to the OUT variable.
OUT = dir(list)
# ----------------------------------------
parameters = Element.Parameters(family_types)
code_block = CodeBlock {  }
python_script_3 = Python()  # unwired: IN[0]
# ---------- python_script_3.python (31 lines) ----------
import clr
clr.AddReference("ProtoGeometry")
from Autodesk.DesignScript.Geometry import *
# Import RevitAPI
clr.AddReference("RevitAPI")
from Autodesk.Revit.DB import *
clr.AddReference("RevitAPIUI")
from Autodesk.Revit.UI import TaskDialog
# Import DocumentManager and TransactionManager
clr.AddReference("RevitServices")
from RevitServices.Persistence import DocumentManager
from RevitServices.Transactions import TransactionManager
# Import ToProtoType, ToRevitType geometry conversion extension methods
clr.AddReference("RevitNodes")
import Revit
clr.ImportExtensions(Revit.GeometryConversion)

doc = DocumentManager.Instance.CurrentDBDocument
uiapp = DocumentManager.Instance.CurrentUIApplication
app = uiapp.Application

list = FilteredElementCollector(doc).OfClass(FamilySymbol).ToElements()

inPlaceFamily = []

for l in list:
	if l.Family.IsInPlace == True:
		inPlaceFamily.append(l)
	
#Assign your output to the OUT variable.
OUT = inPlaceFamily
# ----------------------------------------
