# Dynamo graph Filled Region Owner View.dyn (Dynamo 0.8.2.2392)

select_model_element = DSModelElementSelection()  # 1 picked in the model
identity = Object.Identity(select_model_element)
categories = Categories("FilledRegion")
all_elements_of_category = ElementsOfCategory(categories)
watch = Watch(all_elements_of_category)
element_types = ElementTypes("FilledRegion")
all_elements_of_type = ElementsOfType(element_types)
name = Element.Name(all_elements_of_type)
watch_2 = Watch(all_elements_of_type)
getParameterValueByName = Element.GetParameterValueByName(element=watch_2)
filter_element_list_by_type = Custom[Filter Element List by Type Parameter Value]()
python_script = Python(IN[0]=watch_2)
# ---------- python_script.python (16 lines) ----------
import clr
clr.AddReference('RevitAPI')
from Autodesk.Revit.DB import *

clr.AddReference("RevitNodes")
import Revit
clr.ImportExtensions(Revit.Elements)

items = UnwrapElement(IN[0])
elementlist = list()
for item in items:
	try:
		elementlist.append(item.Document.GetElement(item.OwnerViewId).ToDSType(True))
	except:
		elementlist.append(list())
OUT = elementlist
# ----------------------------------------
name_2 = Element.Name(python_script)
element_types_2 = ElementTypes("FilledRegionType")
all_elements_of_type_2 = ElementsOfType(element_types_2)
watch_3 = Watch(all_elements_of_type_2)
name_3 = Element.Name(watch_3)
python_script_2 = Python(IN[0]=all_elements_of_type)
# ---------- python_script_2.python (47 lines) ----------
#python nodes in dynamo 0.7
#proposed by Julien Benoit @jbenoit44 
#http://aecuandme.wordpress.com/
import clr
clr.AddReference('ProtoGeometry')
from Autodesk.DesignScript.Geometry import *

# Import ToDSType(bool) extension method
clr.AddReference("RevitNodes")
import Revit
clr.ImportExtensions(Revit.Elements)

# Import DocumentManager and TransactionManager
clr.AddReference("RevitServices")
import RevitServices
from RevitServices.Persistence import DocumentManager
from RevitServices.Transactions import TransactionManager

from System.Collections.Generic import *

# Import RevitAPI
clr.AddReference("RevitAPI")
import Autodesk

doc = DocumentManager.Instance.CurrentDBDocument
uiapp = DocumentManager.Instance.CurrentUIApplication
app = uiapp.Application

dataEnteringNode = IN[0]

#unwrap all elements to use with API
a=UnwrapElement(IN[0])

b = []
# "Start" the transaction
TransactionManager.Instance.EnsureInTransaction(doc)

for element in a:
	#b=a.GetType().ToString()
	b.append(element.GetTypeId().ToString())

# "End" the transaction
TransactionManager.Instance.TransactionTaskDone()


#Assign your output to the OUT variable
OUT = b
# ----------------------------------------
class_ = Custom[Object.Class](obj=python_script_2)  # Gets the input object's class name. Can process lists.
code_block = CodeBlock(a=watch_3) { a[93].Id; }
string_from_object = FromObject(code_block)
eq = python_script_2 == string_from_object
filterByBoolMask = List.FilterByBoolMask(list=all_elements_of_type, mask=eq)
python_script_3 = Python(IN[0]=filterByBoolMask.in)  # same code as python_script
name_4 = Element.Name(python_script_3)
watch_4 = Custom[Watch+](input=name_4)  # This node that serializes the input information and presents it in a resizable text window.
