# Dynamo graph Copy View Filters.dyn (Dynamo 1.2.0.2514)

get_all_views = Custom[Get All Views]()  # This node will query all views in the model and return them based on category
name = Element.Name(get_all_views.3D_Views)

# group: VIEW TO COPY THE FILTERS FROM
string = StringInput("Ch - 3D Building (Bearing Pad Utilisation)")

eq = name == string
filterByBoolMask = List.FilterByBoolMask(list=get_all_views.3D_Views, mask=eq)
filters = View.Filters(filterByBoolMask.in)
addFilter = View.AddFilter(arg1=filters)  # unwired: arg0
name_2 = Element.Name(get_all_views.Engineering_Plans)

# group: VIEW TO APPLY THE FILTERS
string_2 = StringInput("02")

eq_2 = name_2 == string_2
filterByBoolMask_2 = List.FilterByBoolMask(list=get_all_views.Engineering_Plans, mask=eq_2)
python_script = Python(IN[0]=filterByBoolMask_2.in)
# ---------- python_script.python (36 lines) ----------
import clr
clr.AddReference('RevitAPI')
clr.AddReference('RevitAPIUI')
from Autodesk.Revit.DB import *
import Autodesk

# Import DocumentManager and TransactionManager
clr.AddReference("RevitServices")
import RevitServices
from RevitServices.Persistence import DocumentManager

# Import RevitAPI
clr.AddReference("RevitAPI")
import Autodesk
from Autodesk.Revit.DB import *


doc = DocumentManager.Instance.CurrentDBDocument

views = UnwrapElement(IN[0])
elementlist = list()
filterlist = list()

elementlist.append(doc.GetElement(views[0].ViewTemplateId))

#filterlist.append(views[0].GetFilters)

"""
for view in views:
	if view.ViewTemplateId.IntegerValue == -1:
		elementlist.append(list())
	else:
		elementlist.append(doc.GetElement(view.ViewTemplateId))
"""

OUT = elementlist
# ----------------------------------------
filterOverrides = View.FilterOverrides(filterByBoolMask.in, filters)
setFilterOverrides = View.SetFilterOverrides(python_script, filters, filterOverrides)
filters_2 = View.Filters(python_script)
get_all_views_2 = Custom[Get All Views]()
name_3 = Element.Name(get_all_views_2.3D_Views)

# group: VIEW TO APPLY THE FILTERS
string_3 = StringInput("Ch - 3D Building (Bearing Pad Utilisation)")

eq_3 = name_3 == string_3
filterByBoolMask_3 = List.FilterByBoolMask(list=get_all_views_2.3D_Views, mask=eq_3)
python_script_2 = Python(IN[0]=filterByBoolMask_3.in)  # same code as python_script
name_4 = Element.Name(get_all_views_2.3D_Views)

# group: VIEW TO COPY THE FILTERS FROM
string_4 = StringInput("Ch - 3D Building (Suitability Code)")

eq_4 = name_4 == string_4
filterByBoolMask_4 = List.FilterByBoolMask(list=get_all_views_2.3D_Views, mask=eq_4)
filters_3 = View.Filters(filterByBoolMask_4.in)
addFilter_2 = View.AddFilter(python_script_2, filters_3)
filterOverrides_2 = View.FilterOverrides(filterByBoolMask_4.in, filters_3)
setFilterOverrides_2 = View.SetFilterOverrides(arg1=filters_3, arg2=filterOverrides_2)  # unwired: arg0
filters_4 = View.Filters(python_script_2)
get_all_views_3 = Python()  # unwired: IN[0]
# ---------- get_all_views_3.python (18 lines) ----------
import clr

# Import DocumentManager and TransactionManager
clr.AddReference("RevitServices")
import RevitServices
from RevitServices.Persistence import DocumentManager

# Import RevitAPI
clr.AddReference("RevitAPI")
import Autodesk
from Autodesk.Revit.DB import *

doc = DocumentManager.Instance.CurrentDBDocument

collector = FilteredElementCollector(doc).OfCategory(BuiltInCategory.OST_Views)


OUT = collector
# ----------------------------------------
get_all_views_4 = Python()  # unwired: IN[0]
# ---------- get_all_views_4.python (35 lines) ----------
#Copyright(c) 2015, Konrad Sobon
# @arch_laboratory, http://archi-lab.net

import clr
clr.AddReference('ProtoGeometry')
from Autodesk.DesignScript.Geometry import *

# Import DocumentManager and TransactionManager
clr.AddReference("RevitServices")
import RevitServices
from RevitServices.Persistence import DocumentManager
from RevitServices.Transactions import TransactionManager

# Import RevitAPI
clr.AddReference("RevitAPI")
import Autodesk
from Autodesk.Revit.DB import *

doc = DocumentManager.Instance.CurrentDBDocument
uiapp = DocumentManager.Instance.CurrentUIApplication
app = uiapp.Application

from System.Collections.Generic import *

# Import ToDSType(bool) extension method
clr.AddReference("RevitNodes")
import Revit
clr.ImportExtensions(Revit.Elements)


#collect all views in the model
collector = FilteredElementCollector(doc)
views = collector.OfClass(View).ToElements()

OUT = views
# ----------------------------------------
all_views_name = Python()  # unwired: IN[0]
# ---------- all_views_name.python (40 lines) ----------
#Copyright(c) 2015, Konrad Sobon
# @arch_laboratory, http://archi-lab.net

import clr
clr.AddReference('ProtoGeometry')
from Autodesk.DesignScript.Geometry import *

# Import DocumentManager and TransactionManager
clr.AddReference("RevitServices")
import RevitServices
from RevitServices.Persistence import DocumentManager
from RevitServices.Transactions import TransactionManager

# Import RevitAPI
clr.AddReference("RevitAPI")
import Autodesk
from Autodesk.Revit.DB import *

doc = DocumentManager.Instance.CurrentDBDocument
uiapp = DocumentManager.Instance.CurrentUIApplication
app = uiapp.Application

from System.Collections.Generic import *

# Import ToDSType(bool) extension method
clr.AddReference("RevitNodes")
import Revit
clr.ImportExtensions(Revit.Elements)


#collect all views in the model
collector = FilteredElementCollector(doc)
views = collector.OfClass(View).ToElements()

name = []

for item in views:
	name.append(item.Name)

OUT = name
# ----------------------------------------

# group: TEMPLATE TO APPLY THE FILTER
string_5 = StringInput("70 - Sh - G.A. Plan")

eq_5 = all_views_name == string_5
filterByBoolMask_5 = List.FilterByBoolMask(list=get_all_views_4, mask=eq_5)
get_all_views_5 = Python()  # unwired: IN[0]; same code as get_all_views_4
all_views_name_2 = Python()  # unwired: IN[0]; same code as all_views_name

# group: TEMPLATE TO COPY THE FILTERS FROM
string_6 = StringInput("Ch - 3D Building (Suitability Code)")

eq_6 = all_views_name_2 == string_6
filterByBoolMask_6 = List.FilterByBoolMask(list=get_all_views_5, mask=eq_6)
filters_5 = View.Filters(filterByBoolMask_6.in)
addFilter_3 = View.AddFilter(filterByBoolMask_5.in, filters_5)
filterOverrides_3 = View.FilterOverrides(filterByBoolMask_5.in, filters_5)
setFilterOverrides_3 = View.SetFilterOverrides(arg1=filters_5, arg2=filterOverrides_3)  # unwired: arg0
