# Dynamo graph Copy View Filters_00.dyn (Dynamo 1.2.0.2514)

get_all_views = Custom[Get All Views]()  # This node will query all views in the model and return them based on category
name = Element.Name(get_all_views.3D_Views)

# group: VIEW TO APPLY THE FILTERS
string = StringInput("Ch - 3D Building (Bearing Pad Utilisation)")

eq = name == string
filterByBoolMask = List.FilterByBoolMask(list=get_all_views.3D_Views, mask=eq)
python_script = Python(IN[0]=filterByBoolMask.in)
# ---------- python_script.python (36 lines) ----------
import clr
clr.AddReference('RevitAPI')
clr.AddReference('RevitAPIUI')
from Autodesk.Revit.DB import *
import Autodesk

# Import DocumentManager and TransactionManager
clr.AddReference("RevitServices")
import RevitServices
from RevitServices.Persistence import DocumentManager

# Import RevitAPI
clr.AddReference("RevitAPI")
import Autodesk
from Autodesk.Revit.DB import *


doc = DocumentManager.Instance.CurrentDBDocument

views = UnwrapElement(IN[0])
elementlist = list()
filterlist = list()

elementlist.append(doc.GetElement(views[0].ViewTemplateId))

#filterlist.append(views[0].GetFilters)

"""
for view in views:
	if view.ViewTemplateId.IntegerValue == -1:
		elementlist.append(list())
	else:
		elementlist.append(doc.GetElement(view.ViewTemplateId))
"""

OUT = elementlist
# ----------------------------------------
name_2 = Element.Name(get_all_views.3D_Views)

# group: VIEW TO COPY THE FILTERS FROM
string_2 = StringInput("Ch - 3D Building (Suitability Code)")

eq_2 = name_2 == string_2
filterByBoolMask_2 = List.FilterByBoolMask(list=get_all_views.3D_Views, mask=eq_2)
filters = View.Filters(filterByBoolMask_2.in)
addFilter = View.AddFilter(python_script, filters)
filterOverrides = View.FilterOverrides(filterByBoolMask_2.in, filters)
setFilterOverrides = View.SetFilterOverrides(arg1=filters, arg2=filterOverrides)  # unwired: arg0
filters_2 = View.Filters(python_script)
