# Dynamo graph Copy View Filters_01.dyn (Dynamo 1.2.0.2514)

get_all_views = Python()  # unwired: IN[0]
# ---------- get_all_views.python (35 lines) ----------
#Copyright(c) 2015, Konrad Sobon
# @arch_laboratory, http://archi-lab.net

import clr
clr.AddReference('ProtoGeometry')
from Autodesk.DesignScript.Geometry import *

# Import DocumentManager and TransactionManager
clr.AddReference("RevitServices")
import RevitServices
from RevitServices.Persistence import DocumentManager
from RevitServices.Transactions import TransactionManager

# Import RevitAPI
clr.AddReference("RevitAPI")
import Autodesk
from Autodesk.Revit.DB import *

doc = DocumentManager.Instance.CurrentDBDocument
uiapp = DocumentManager.Instance.CurrentUIApplication
app = uiapp.Application

from System.Collections.Generic import *

# Import ToDSType(bool) extension method
clr.AddReference("RevitNodes")
import Revit
clr.ImportExtensions(Revit.Elements)


#collect all views in the model
collector = FilteredElementCollector(doc)
views = collector.OfClass(View).ToElements()

OUT = views
# ----------------------------------------
all_views_name = Python()  # unwired: IN[0]
# ---------- all_views_name.python (40 lines) ----------
#Copyright(c) 2015, Konrad Sobon
# @arch_laboratory, http://archi-lab.net

import clr
clr.AddReference('ProtoGeometry')
from Autodesk.DesignScript.Geometry import *

# Import DocumentManager and TransactionManager
clr.AddReference("RevitServices")
import RevitServices
from RevitServices.Persistence import DocumentManager
from RevitServices.Transactions import TransactionManager

# Import RevitAPI
clr.AddReference("RevitAPI")
import Autodesk
from Autodesk.Revit.DB import *

doc = DocumentManager.Instance.CurrentDBDocument
uiapp = DocumentManager.Instance.CurrentUIApplication
app = uiapp.Application

from System.Collections.Generic import *

# Import ToDSType(bool) extension method
clr.AddReference("RevitNodes")
import Revit
clr.ImportExtensions(Revit.Elements)


#collect all views in the model
collector = FilteredElementCollector(doc)
views = collector.OfClass(View).ToElements()

name = []

for item in views:
	name.append(item.Name)

OUT = name
# ----------------------------------------

# group: TEMPLATE TO APPLY THE FILTER
string = StringInput("10 - Wo - G.A. Site Plan")

eq = all_views_name == string
filterByBoolMask = List.FilterByBoolMask(list=get_all_views, mask=eq)
get_all_views_2 = Python()  # unwired: IN[0]; same code as get_all_views
all_views_name_2 = Python()  # unwired: IN[0]; same code as all_views_name

# group: TEMPLATE TO COPY THE FILTERS FROM
string_2 = StringInput("30 - Ch - 3D Building (Suitability Code)")

eq_2 = all_views_name_2 == string_2
filterByBoolMask_2 = List.FilterByBoolMask(list=get_all_views_2, mask=eq_2)
filters = View.Filters(filterByBoolMask_2.in)
addFilter = View.AddFilter(filterByBoolMask.in, filters)
filterOverrides = View.FilterOverrides(filterByBoolMask_2.in, filters)
setFilterOverrides = View.SetFilterOverrides(filterByBoolMask.in, filters, filterOverrides)
name = Element.Name(filters)
