# Dynamo custom node Filter.GetUnusedv8.dyf (Dynamo 0.8.2.2392)
# category: BVN.Selection.Actions
# Returns all unused filters in the project so that they can be used. Use in conjunction with 'Tool.Eraser' from the SteamNodes package or 'Delete.Elements' from Grimshaw package.

# note: Copyright(c) 2016, Paul Wintour
# BVN, http://www.bvn.com.au/
# Licence: http://creativecommons.org/licenses/by-sa/4.0/
Toggle = Input(Toggle : bool)  # Boolean toggle to refresh Python script
python_script = Python(IN[0]=Toggle)
# ---------- python_script.python (54 lines) ----------
import clr
clr.AddReference('ProtoGeometry')
from Autodesk.DesignScript.Geometry import *

clr.AddReference("System.Core")
import System.Linq
clr.ImportExtensions(System.Linq)

clr.AddReference("RevitAPI")
import Autodesk.Revit
from Autodesk.Revit.Exceptions import InvalidOperationException
from Autodesk.Revit.DB import *

# Import ToDSType(bool) extension method
clr.AddReference("RevitNodes")
import Revit
clr.ImportExtensions(Revit.Elements)

# Import DocumentManager
clr.AddReference("RevitServices")
import RevitServices
from RevitServices.Persistence import DocumentManager

def GetFilterIds(view):
  filterIds = None
  try:
    filterIds = view.GetFilters()
  except InvalidOperationException, e:
    filterIds = None
  return filterIds

def GetUsedFilterIds(doc):
  views = FilteredElementCollector(doc).OfClass(View).ToElements()
  usedFilterIds = []
  for view in views:
    viewFilterIds = []
    try:
      viewFilterIds = view.GetFilters()
    except InvalidOperationException, e:
      pass # this exception happens when a view doesn't support filters
    usedFilterIds.extend(viewFilterIds)
  return usedFilterIds

def GetUnusedFilters(doc):
  usedFilterIds = GetUsedFilterIds(doc).ToList[ElementId]()
  unusedFilters = FilteredElementCollector(doc).OfClass(ParameterFilterElement).Excluding(usedFilterIds).ToElements()
  return list(f.ToDSType(True) for f in unusedFilters)

#The inputs to this node will be stored as a list in the IN variables.

doc = DocumentManager.Instance.CurrentDBDocument

#Assign your output to the OUT variable.
OUT = GetUnusedFilters(doc)
# ----------------------------------------
element = Output(python_script)
