# Dynamo graph Get Unused Filters.dyn (Dynamo 0.8.2.2392)

boolean = BoolSelector(true)
getFilterIds = Python(IN[0]=boolean)
# ---------- getFilterIds.python (54 lines) ----------
import clr
clr.AddReference('ProtoGeometry')
from Autodesk.DesignScript.Geometry import *

clr.AddReference("System.Core")
import System.Linq
clr.ImportExtensions(System.Linq)

clr.AddReference("RevitAPI")
import Autodesk.Revit
from Autodesk.Revit.Exceptions import InvalidOperationException
from Autodesk.Revit.DB import *

# Import ToDSType(bool) extension method
clr.AddReference("RevitNodes")
import Revit
clr.ImportExtensions(Revit.Elements)

# Import DocumentManager
clr.AddReference("RevitServices")
import RevitServices
from RevitServices.Persistence import DocumentManager

def GetFilterIds(view):
  filterIds = None
  try:
    filterIds = view.GetFilters()
  except InvalidOperationException, e:
    filterIds = None
  return filterIds

def GetUsedFilterIds(doc):
  views = FilteredElementCollector(doc).OfClass(View).ToElements()
  usedFilterIds = []
  for view in views:
    viewFilterIds = []
    try:
      viewFilterIds = view.GetFilters()
    except InvalidOperationException, e:
      pass # this exception happens when a view doesn't support filters
    usedFilterIds.extend(viewFilterIds)
  return usedFilterIds

def GetUnusedFilters(doc):
  usedFilterIds = GetUsedFilterIds(doc).ToList[ElementId]()
  unusedFilters = FilteredElementCollector(doc).OfClass(ParameterFilterElement).Excluding(usedFilterIds).ToElements()
  return list(f.ToDSType(True) for f in unusedFilters)

#The inputs to this node will be stored as a list in the IN variables.

doc = DocumentManager.Instance.CurrentDBDocument

#Assign your output to the OUT variable.
OUT = GetUsedFilterIds(doc)
# ----------------------------------------
views = Python()
# ---------- views.python (37 lines) ----------
import clr
clr.AddReference('ProtoGeometry')
from Autodesk.DesignScript.Geometry import *

clr.AddReference("System.Core")
import System.Linq
clr.ImportExtensions(System.Linq)

clr.AddReference("RevitAPI")
import Autodesk.Revit
from Autodesk.Revit.Exceptions import InvalidOperationException
from Autodesk.Revit.DB import *

# Import ToDSType(bool) extension method
clr.AddReference("RevitNodes")
import Revit
clr.ImportExtensions(Revit.Elements)

# Import DocumentManager
clr.AddReference("RevitServices")
import RevitServices
from RevitServices.Persistence import DocumentManager

doc = DocumentManager.Instance.CurrentDBDocument

views = FilteredElementCollector(doc).OfClass(View).ToElements()

for view in views:
	viewFilterIds = []
	try:
		viewFilterIds = view()
	except InvalidOperationException, e:
		pass # this exception happens when a view doesn't support filters
	usedFilterIds.extend(viewFilterIds)

#Assign your output to the OUT variable.
OUT = views
# ----------------------------------------
get_used_filter = Python(IN[0]=boolean)  # same code as getFilterIds
id_to_element = Python(IN[0]=get_used_filter)
# ---------- id_to_element.python (78 lines) ----------
# Copyright(c) 2016, Konrad Sobon
# @arch_laboratory, http://archi-lab.net

# Import ToDSType(bool) extension method
import clr
clr.AddReference("RevitNodes")
import Revit
clr.ImportExtensions(Revit.Elements)

# Import DocumentManager and TransactionManager
clr.AddReference("RevitServices")
import RevitServices
from RevitServices.Persistence import DocumentManager
doc = DocumentManager.Instance.CurrentDBDocument

# Import RevitAPI
clr.AddReference("RevitAPI")
import Autodesk
from Autodesk.Revit.DB import *

import sys
pyt_path = r'C:\Program Files (x86)\IronPython 2.7\Lib'
sys.path.append(pyt_path)

from System.Collections.Generic import *

#The inputs to this node will be stored as a list in the IN variable.
dataEnteringNode = IN

def ProcessList(_func, _list):
    return map( lambda x: ProcessList(_func, x) if type(x)==list else _func(x), _list )

def Unwrap(item):
	return UnwrapElement(item)

def ToRevitId(_id):
	if isinstance(_id, int):
		id = ElementId(int(_id))
		return ("ElementId", id)
	elif isinstance(_id, basestring) and len(_id) > 8:
		return ("GUID", _id)
	elif isinstance(_id, basestring) and len(_id) < 8:
		id = ElementId(int(_id))
		return ("ElementId", id)
	elif isinstance(_id, Autodesk.Revit.DB.ElementId):
		return ("ElementId", _id)
	else:
		return None

def ProcessIds(_id):
	id = ToRevitId(_id)
	if id == None:
		return None
	elif id[0] == "ElementId":
		return doc.GetElement.Overloads[Autodesk.Revit.DB.ElementId](id[1]).ToDSType(True)
	else:
		return doc.GetElement.Overloads[str](id[1]).ToDSType(True)

#unwrap incoming information for use with API
if isinstance(IN[0], list):
	ids = ProcessList(Unwrap, IN[0])
else:
	ids = [Unwrap(IN[0])]
    
try:
	errorReport = None
	elements = []
	output = ProcessList(ProcessIds, ids)
except:
	# if error accurs anywhere in the process catch it
	import traceback
	errorReport = traceback.format_exc()

#Assign your output to the OUT variable
if errorReport == None:
	OUT = output
else:
	OUT = errorReport
# ----------------------------------------
name = Element.Name(id_to_element)
code_block = CodeBlock { "(9)"; }
code_block_2 = CodeBlock { 1; }
contains = String.Contains(str=name, searchFor=code_block, ignoreCase=code_block_2)
filterByBoolMask = List.FilterByBoolMask(list=id_to_element, mask=contains)
get_all_views = Custom[Get All Views]()  # This node will query all views in the model and return them based on category
usedFilterIds = Python(IN[0]=get_all_views.Engineering_Plans)
# ---------- usedFilterIds.python (45 lines) ----------
import clr
clr.AddReference('ProtoGeometry')
from Autodesk.DesignScript.Geometry import *

clr.AddReference("System.Core")
import System.Linq
clr.ImportExtensions(System.Linq)

clr.AddReference("RevitAPI")
import Autodesk.Revit
from Autodesk.Revit.Exceptions import InvalidOperationException
from Autodesk.Revit.DB import *

# Import ToDSType(bool) extension method
clr.AddReference("RevitNodes")
import Revit
clr.ImportExtensions(Revit.Elements)

# Import DocumentManager
clr.AddReference("RevitServices")
import RevitServices
from RevitServices.Persistence import DocumentManager

doc = DocumentManager.Instance.CurrentDBDocument

#views = FilteredElementCollector(doc).OfClass(View).ToElements()

views = UnwrapElement(IN[0])

usedFilterIds = []

for view in views:
	viewFilterIds = []
	try:
		viewFilterIds = view.GetFilters()
	except InvalidOperationException, e:
		pass # this exception happens when a view doesn't support filters
	usedFilterIds.append(viewFilterIds)

#The inputs to this node will be stored as a list in the IN variables.



#Assign your output to the OUT variable.
OUT = usedFilterIds
# ----------------------------------------
code_block_3 = CodeBlock(a=usedFilterIds) { a[0][0]; }
id_to_element_2 = Python(IN[0]=code_block_3)  # same code as id_to_element
name_2 = Element.Name(id_to_element_2)
getUnusedv8 = Custom[Filter.GetUnusedv8](Toggle=boolean)  # Returns all unused filters in the project so that they can be used. Use in conjunction with 'Tool.Eraser' from the SteamNodes package or 'Delete.Elements' from Grimshaw package.
name_3 = Element.Name(getUnusedv8)
watch = Watch(name_3)
code_block_4 = CodeBlock(a=get_used_filter) { a[8]; }
name_4 = Element.Name(code_block_4)
flatten = Flatten(usedFilterIds)
string_from_object = FromObject(flatten)
code_block_5 = CodeBlock { "1970463"; }
code_block_6 = CodeBlock { 1; }
contains_2 = String.Contains(str=string_from_object, searchFor=code_block_5, ignoreCase=code_block_6)
code_block_7 = CodeBlock { true; }
indexOf = IndexOf(contains_2, code_block_7)
code_block_8 = CodeBlock { 1; }
watch_2 = Watch(get_all_views.Engineering_Plans)
name_5 = Element.Name(watch_2)
containsItem = List.ContainsItem(list=usedFilterIds, item=code_block_4, lacing=Longest)
filterByBoolMask_2 = List.FilterByBoolMask(list=name_5, mask=containsItem)
