# Dynamo graph Get Unused Filters01.dyn (Dynamo 0.8.2.2392)

# group: SELECT EXCEL FILE
file_path = Filename("\\global.arup.com\london\ILG\JOBS\239000\239762-00 RMP\4 Internal Data\05 1F4\08 BIM\02 Structural\Links\10 Excel\01_Substructure\UnusedFilters")

code_block = CodeBlock { {"Unused Filters"}; }
code_block_2 = CodeBlock { 0; }
boolean = BoolSelector(true)
getUnusedv8 = Custom[Filter.GetUnusedv8](Toggle=boolean)  # Returns all unused filters in the project so that they can be used. Use in conjunction with 'Tool.Eraser' from the SteamNodes package or 'Delete.Elements' from Grimshaw package.
name = Element.Name(getUnusedv8)
watch = Watch(name)
code_block_3 = CodeBlock { 0; }
writeToFile = Excel.WriteToFile(filePath=file_path, sheetName=code_block, startRow=code_block_2, startCol=code_block_2, data=watch, overWrite=code_block_3)

# group: SELECT EXCEL FILE
file_path_2 = Filename("\\global.arup.com\london\ILG\JOBS\239000\239762-00 RMP\4 Internal Data\05 1F4\08 BIM\02 Structural\Links\10 Excel\01_Substructure\UnusedFilters")

code_block_4 = CodeBlock { {"Views Filters"}; }
code_block_5 = CodeBlock { 0; }
addItemToFront = List.AddItemToFront()
python_script = Python()
# ---------- python_script.python (100 lines) ----------
#Copyright(c) 2015, Konrad Sobon
# @arch_laboratory, http://archi-lab.net

import clr
clr.AddReference('ProtoGeometry')
from Autodesk.DesignScript.Geometry import *

# Import DocumentManager and TransactionManager
clr.AddReference("RevitServices")
import RevitServices
from RevitServices.Persistence import DocumentManager
from RevitServices.Transactions import TransactionManager

# Import RevitAPI
clr.AddReference("RevitAPI")
import Autodesk
from Autodesk.Revit.DB import *

doc = DocumentManager.Instance.CurrentDBDocument
uiapp = DocumentManager.Instance.CurrentUIApplication
app = uiapp.Application

from System.Collections.Generic import *

# Import ToDSType(bool) extension method
clr.AddReference("RevitNodes")
import Revit
clr.ImportExtensions(Revit.Elements)

#The inputs to this node will be stored as a list in the IN variable.
dataEnteringNode = IN

#collect all views in the model
collector = FilteredElementCollector(doc)
views = collector.OfClass(View).ToElements()

#sort views into separate lists based on view type
areaPlans, ceilingPlans, columnSchedules = [], [], []
costReport, details, draftingViews = [], [], []
drawingSheets, elevations, engineetingPlans = [], [], []
floorPlans, internal, legends, loadReports = [], [], [], []
panelSchedules, pressureLossReports, renderings = [], [], []
reports, schedules, sections, threeD = [], [], [], []
undefined, walkthrough = [], []
for i in views:
	if not i.IsTemplate:
		if i.ViewType == ViewType.AreaPlan:
			areaPlans.append(i.ToDSType(True))
		elif i.ViewType == ViewType.CeilingPlan:
			ceilingPlans.append(i.ToDSType(True))
		elif i.ViewType == ViewType.ColumnSchedule:
			columnSchedules.append(i.ToDSType(True))
		elif i.ViewType == ViewType.CostReport:
			costReport.append(i.ToDSType(True))
		elif i.ViewType == ViewType.Detail:
			details.append(i.ToDSType(True))
		elif i.ViewType == ViewType.DraftingView:
			draftingViews.append(i.ToDSType(True))
		elif i.ViewType == ViewType.DrawingSheet:
			drawingSheets.append(i.ToDSType(True))
		elif i.ViewType == ViewType.Elevation:
			elevations.append(i.ToDSType(True))
		elif i.ViewType == ViewType.EngineeringPlan:
			engineetingPlans.append(i.ToDSType(True))
		elif i.ViewType == ViewType.FloorPlan:
			floorPlans.append(i.ToDSType(True))
		elif i.ViewType == ViewType.Internal:
			internal.append(i.ToDSType(True))
		elif i.ViewType == ViewType.Legend:
			legends.append(i.ToDSType(True))
		elif i.ViewType == ViewType.LoadsReport:
			loadReports.append(i.ToDSType(True))
		elif i.ViewType == ViewType.PanelSchedule:
			panelSchedules.append(i.ToDSType(True))
		elif i.ViewType == ViewType.PresureLossReport:
			pressureLossReports.append(i.ToDSType(True))
		elif i.ViewType == ViewType.Rendering:
			renderings.append(i.ToDSType(True))
		elif i.ViewType == ViewType.Report:
			reports.append(i.ToDSType(True))
		elif i.ViewType == ViewType.Schedule:
			schedules.append(i.ToDSType(True))
		elif i.ViewType == ViewType.Section:
			sections.append(i.ToDSType(True))
		elif i.ViewType == ViewType.ThreeD:
			threeD.append(i.ToDSType(True))
		elif i.ViewType == ViewType.Undefined:
			undefined.append(i.ToDSType(True))
		elif i.ViewType == ViewType.Walkthrough:
			walkthrough.append(i.ToDSType(True))
		else:
			continue

#Assign your output to the OUT variable
OUT = areaPlans, ceilingPlans, columnSchedules, costReport, \
	details, draftingViews, drawingSheets, elevations, \
	engineetingPlans, floorPlans, internal, legends, \
	loadReports, panelSchedules, pressureLossReports, \
	renderings, reports, schedules, sections, threeD, \
	undefined, walkthrough
# ----------------------------------------
flatten = Flatten(python_script)
name_2 = Element.Name(flatten)
usedFilterIds = Python(IN[0]=flatten)
# ---------- usedFilterIds.python (45 lines) ----------
import clr
clr.AddReference('ProtoGeometry')
from Autodesk.DesignScript.Geometry import *

clr.AddReference("System.Core")
import System.Linq
clr.ImportExtensions(System.Linq)

clr.AddReference("RevitAPI")
import Autodesk.Revit
from Autodesk.Revit.Exceptions import InvalidOperationException
from Autodesk.Revit.DB import *

# Import ToDSType(bool) extension method
clr.AddReference("RevitNodes")
import Revit
clr.ImportExtensions(Revit.Elements)

# Import DocumentManager
clr.AddReference("RevitServices")
import RevitServices
from RevitServices.Persistence import DocumentManager

doc = DocumentManager.Instance.CurrentDBDocument

#views = FilteredElementCollector(doc).OfClass(View).ToElements()

views = UnwrapElement(IN[0])

usedFilterIds = []

for view in views:
	viewFilterIds = []
	try:
		viewFilterIds = view.GetFilters()
	except InvalidOperationException, e:
		pass # this exception happens when a view doesn't support filters
	usedFilterIds.append(viewFilterIds)

#The inputs to this node will be stored as a list in the IN variables.



#Assign your output to the OUT variable.
OUT = usedFilterIds
# ----------------------------------------
id_to_element = Python(IN[0]=usedFilterIds)
# ---------- id_to_element.python (78 lines) ----------
# Copyright(c) 2016, Konrad Sobon
# @arch_laboratory, http://archi-lab.net

# Import ToDSType(bool) extension method
import clr
clr.AddReference("RevitNodes")
import Revit
clr.ImportExtensions(Revit.Elements)

# Import DocumentManager and TransactionManager
clr.AddReference("RevitServices")
import RevitServices
from RevitServices.Persistence import DocumentManager
doc = DocumentManager.Instance.CurrentDBDocument

# Import RevitAPI
clr.AddReference("RevitAPI")
import Autodesk
from Autodesk.Revit.DB import *

import sys
pyt_path = r'C:\Program Files (x86)\IronPython 2.7\Lib'
sys.path.append(pyt_path)

from System.Collections.Generic import *

#The inputs to this node will be stored as a list in the IN variable.
dataEnteringNode = IN

def ProcessList(_func, _list):
    return map( lambda x: ProcessList(_func, x) if type(x)==list else _func(x), _list )

def Unwrap(item):
	return UnwrapElement(item)

def ToRevitId(_id):
	if isinstance(_id, int):
		id = ElementId(int(_id))
		return ("ElementId", id)
	elif isinstance(_id, basestring) and len(_id) > 8:
		return ("GUID", _id)
	elif isinstance(_id, basestring) and len(_id) < 8:
		id = ElementId(int(_id))
		return ("ElementId", id)
	elif isinstance(_id, Autodesk.Revit.DB.ElementId):
		return ("ElementId", _id)
	else:
		return None

def ProcessIds(_id):
	id = ToRevitId(_id)
	if id == None:
		return None
	elif id[0] == "ElementId":
		return doc.GetElement.Overloads[Autodesk.Revit.DB.ElementId](id[1]).ToDSType(True)
	else:
		return doc.GetElement.Overloads[str](id[1]).ToDSType(True)

#unwrap incoming information for use with API
if isinstance(IN[0], list):
	ids = ProcessList(Unwrap, IN[0])
else:
	ids = [Unwrap(IN[0])]
    
try:
	errorReport = None
	elements = []
	output = ProcessList(ProcessIds, ids)
except:
	# if error accurs anywhere in the process catch it
	import traceback
	errorReport = traceback.format_exc()

#Assign your output to the OUT variable
if errorReport == None:
	OUT = output
else:
	OUT = errorReport
# ----------------------------------------
name_3 = Element.Name(id_to_element)
laceShortest = List.LaceShortest(addItemToFront, name_2, name_3)
transpose = List.Transpose(laceShortest)
writeToFile_2 = Excel.WriteToFile(filePath=file_path_2, sheetName=code_block_4, startRow=code_block_5, startCol=code_block_5, data=transpose, overWrite=code_block_5)
code_block_6 = CodeBlock { {"Filters Utilisation"}; }
code_block_7 = CodeBlock { 0; }
countOccurences = Custom[List.CountOccurences](seq=usedFilterIds)  # Counts the number of occurences of each unique element in a given list
id_to_element_2 = Python(IN[0]=countOccurences.uniqueElements)  # same code as id_to_element
name_4 = Element.Name(id_to_element_2)
code_block_8 = CodeBlock(c=name_4, d=countOccurences.count) { {c,d}; }
transpose_2 = List.Transpose(code_block_8)
writeToFile_3 = Excel.WriteToFile(sheetName=code_block_6, startRow=code_block_7, startCol=code_block_7, data=transpose_2, overWrite=code_block_7)

# group: SELECT EXCEL FILE
file_path_3 = Filename("\\global.arup.com\london\ILG\JOBS\239000\239762-00 RMP\4 Internal Data\05 1F4\08 BIM\02 Structural\Links\10 Excel\01_Substructure\UnusedFilters")
