# Dynamo graph Floor by points.dyn (Dynamo 0.8.2.2392)

file_path = Filename("C:\Users\giovanni.brogioli\Desktop\PTSS.txt")
fromPath = FileObject(file_path)  # "File.FromPath"
readText = File.ReadText(fromPath)
code_block = CodeBlock { '"'; }
split = String.Split(readText, code_block)
code_block_2 = CodeBlock { 2; }
code_block_3 = CodeBlock { 3; }
takeEveryNthItem = List.TakeEveryNthItem(split, code_block_2, code_block_3)
code_block_4 = CodeBlock { 3; }
chop = List.Chop(takeEveryNthItem, code_block_4)
toNumber = String.ToNumber(chop)
python_script = Python(IN[0]=toNumber)
# ---------- python_script.python (11 lines) ----------
import clr
clr.AddReference('ProtoGeometry')
from Autodesk.DesignScript.Geometry import *
#The inputs to this node will be stored as a list in the IN variables.
pts = IN[0]
topoPts = []
for i in range(0,len(pts)):
	topoPts.append(Point.ByCoordinates(pts[i][0],pts[i][1],pts[i][2]))

#Assign your output to the OUT variable.
OUT = topoPts
# ----------------------------------------
select_model_element = DSModelElementSelection()  # 1 picked in the model
slabShapeByPoints = Custom[Floor.SlabShapeByPoints](points=python_script, floor=select_model_element)  # Transform a slab shape based on a list of XYZs. PLEASE NOTE: Will reset any previous edits on the slab shape.
byPoints = Topography.ByPoints()
select_model_element_2 = DSModelElementSelection()
points = Topography.Points(select_model_element_2)
