# Dynamo graph 01_Floor from the room.dyn (Dynamo 1.2.3.592)

categories = Categories("Rooms")
all_elements_of_category = ElementsOfCategory(categories)

# group: FROM CLOCKWORK
boundaries = Custom[Room.Boundaries](Room=all_elements_of_category)  # This node returns all Room bounding curves and elements that generated them (walls, separation lines etc).

coreBoundary = Room.CoreBoundary(all_elements_of_category)
categories_2 = Categories("Rooms")
all_elements_of_category_2 = ElementsOfCategory(categories_2)
geometry = Element.Geometry(all_elements_of_category_2)
flatten = Flatten(geometry)
explode = Geometry.Explode(flatten)
code_block = CodeBlock { 1; }
getItemAtIndex = List.GetItemAtIndex(list=explode, index=code_block, lacing=Longest)
perimeterCurves = Surface.PerimeterCurves(getItemAtIndex)
floor_types = FloorTypes("Floor 1")
code_block_2 = CodeBlock { "Level"; }
getParameterValueByName = Element.GetParameterValueByName(element=all_elements_of_category, parameterName=code_block_2)

# group: FROM ARCHILAB
get_level_by_name = Custom[Get Level by Name](Level_Name=getParameterValueByName, lacing=Longest)  # This node will retrieve a Revit Level Element by its name.

byOutlineTypeAndLevel = Floor.ByOutlineTypeAndLevel(outlineCurves=perimeterCurves, floorType=floor_types, level=get_level_by_name)
