# Dynamo graph Floor By point.dyn (Dynamo 0.8.2.2392)

select_faces = SelectFaces()  # 9 picked in the model
vertices = Face.Vertices(select_faces)
code_block = CodeBlock { 1; }
flatten = List.Flatten(list=vertices, amt=code_block)
code_block_2 = CodeBlock(a=flatten) { a[4]; }
pointGeometry = Vertex.PointGeometry(code_block_2)
select_model_elements = DSModelElementsSelection()  # 1 picked in the model
slabShapeByPoints = Custom[Roof.SlabShapeByPoints](points=pointGeometry, roof=select_model_elements)  # Transform a slab shape based on a list of XYZs. PLEASE NOTE: Will reset any previous edits on the slab shape.
