# Dynamo graph Floor by Room.dyn (Dynamo 1.2.3.592)

categories = Categories("Rooms")
all_elements_of_category = ElementsOfCategory(categories)

# group: FROM CLOCKWORK
boundaries = Custom[Room.Boundaries](Room=all_elements_of_category)  # This node returns all Room bounding curves and elements that generated them (walls, separation lines etc).

code_block = CodeBlock { 0.5; }
normalAtParameter = Curve.NormalAtParameter(curve=boundaries.Curve, param=code_block)
bv_get_wall_width = Custom[bv Get Wall Width](Wall_s=boundaries.Element, lacing=Longest)  # from steam nodes
translate = Geometry.Translate(geometry=boundaries.Curve, direction=normalAtParameter, distance=bv_get_wall_width)
direction = Line.Direction(translate)
Y = Vector.Y(direction)
abs = Math.Abs(Y)
code_block_2 = CodeBlock(a=abs) { a/10; }
extendStart = Curve.ExtendStart(curve=translate, distance=code_block_2)
X = Vector.X(direction)
abs_2 = Math.Abs(X)
code_block_3 = CodeBlock(a=abs_2) { a/10; }
extendEnd = Curve.ExtendEnd(curve=translate, distance=code_block_3)
findIntersections = Geometry.Intersection.FindIntersections(extendStart, extendEnd)
flatten = Flatten(findIntersections@L3)
class_ = Custom[Object.Class](obj=flatten, lacing=Longest)  # Gets the input object's class name. Can process lists.
code_block_4 = CodeBlock { "Point"; }
code_block_5 = CodeBlock { 1; }
contains = String.Contains(str=class_.class_str, searchFor=code_block_4, ignoreCase=code_block_5)
filterByBoolMask = List.FilterByBoolMask(list=flatten, mask=contains)
flatten_2 = Flatten(filterByBoolMask.in@L2)
code_block_6 = CodeBlock { 0; }
getItemAtIndex = List.GetItemAtIndex(list=flatten_2, index=code_block_6, lacing=Longest)
code_block_7 = CodeBlock { 1; }
getItemAtIndex_2 = List.GetItemAtIndex(list=flatten_2, index=code_block_7, lacing=Longest)
byStartPointEndPoint = Line.ByStartPointEndPoint(startPoint=getItemAtIndex, endPoint=getItemAtIndex_2)
code_block_8 = CodeBlock { 0.5; }
pointAtParameter = Curve.PointAtParameter(curve=byStartPointEndPoint, param=code_block_8)
deconstructPoint = Geometry.Points.DeconstructPoint(pointAtParameter)
code_block_9 = CodeBlock(x=deconstructPoint.out0, y=deconstructPoint.out1, z=deconstructPoint.out2) { CoordinateSystem.ByOrigin(x,y,z); }
deconstructPoint_2 = Geometry.Points.DeconstructPoint(getItemAtIndex)
deconstructPoint_3 = Geometry.Points.DeconstructPoint(getItemAtIndex_2)
code_block_10 = CodeBlock(a=deconstructPoint_2.out0, b=deconstructPoint_3.out0) { Math.Abs(a-b); }
code_block_11 = CodeBlock(a=deconstructPoint_2.out1, b=deconstructPoint_3.out1) { a-b; }
byWidthLength = Rectangle.ByWidthLength(cs=code_block_9, width=code_block_10, length=code_block_11)
floor_types = FloorTypes("STR-Conc Precast Lwt-1800 (300mm)")
code_block_12 = CodeBlock { "Level"; }
getParameterValueByName = Element.GetParameterValueByName(element=all_elements_of_category, parameterName=code_block_12)

# group: FROM ARCHILAB
get_level_by_name = Custom[Get Level by Name](Level_Name=getParameterValueByName, lacing=Longest)  # This node will retrieve a Revit Level Element by its name.

byOutlineTypeAndLevel = Floor.ByOutlineTypeAndLevel(outlineCurves=byWidthLength, floorType=floor_types, level=get_level_by_name, lacing=Longest)
location = Room.Location(all_elements_of_category)
normal = Plane.Normal(boundaries.Curve)
Z = Vector.Z(normal)
location_2 = Custom[Element.Location](element=boundaries.Element)  # Returns the location of an element as an XYZ (or if it's line-based the start and end point of the line), along with some booleans to help filtering the results. Use this for some element types (e.g. walls or lines) that do not work with the built-in Get Family Instance Location node.
count = List.Count(boundaries.Element, lacing=Longest)
chop = List.Chop(list=location_2.curves, lengths=count)
code_block_13 = CodeBlock(a=location_2.curves) { a; }
simplify = Custom[CurveLoop.Simplify]()  # Attempts to simplify an open or a closed curve loop by connecting straight separate line segments into a single line.; unwired: curveLoop
code_block_14 = CodeBlock()
# ---------- code_block_14.designscript (39 lines) ----------
def isLine(c1){
return = c1.Length == Line.ByBestFitThroughPoints
(c1.PointAtParameter({0,1})).Length;
};
def cVec(c1){
return = Vector.ByTwoPoints(c1.StartPoint,c1.EndPoint);
};
def cPts(c1){
return =c1.PointAtParameter({0,1});
};

def merge1(lines:var[]){
return = [Imperative]{
lines = PolyCurve.ByJoinedCurves(lines).Curves();
i = 0;
out1 = {};
while (i < Count(lines))
{
 pts = cPts(lines[i]);
 while (isLine(lines[i+1]) && cVec(lines[i])
 .AngleBetween(cVec(lines[i+1])) < 0.0001)
 {
  pts = List.Join({pts, cPts(lines[i+1])});
  i = i + 1;
 }
 if (Count(pts) == 2)
 {
  out1 = List.Join({out1,lines[i]});
  i = i + 1;
 }
 else
 {
  out1 = List.Join({out1,Line.ByBestFitThroughPoints(pts)});
  i = i + 1;
 }
}
return = out1;
}
};
# ----------------------------------------
coreBoundary = Room.CoreBoundary(all_elements_of_category)
code_block_15 = CodeBlock { 1; }
pointAtParameter_2 = Curve.PointAtParameter(param=code_block_15)  # unwired: curve
