# Dynamo graph Gsa.dyn (Dynamo 1.2.0.2514)

select_model_elements = DSModelElementsSelection()  # 9 picked in the model
watch = Watch(select_model_elements)
flux_project = ProjectsNodeModel()
flow_control = FlowControlNodeModel()
geometry = Element.Geometry(select_model_elements)
send_to_flux = ToFluxNodeModel(flux_project, flow_control, geometry)
flux_project_2 = ProjectsNodeModel()
flow_control_2 = FlowControlNodeModel()
code_block = CodeBlock { 0; }
getItemAtIndex = List.GetItemAtIndex(index=code_block)  # unwired: list
map = List.Map(list=geometry, f_x=getItemAtIndex)
deconstructSurface = Geometry.Surfaces.DeconstructSurface(map)
flatten = Flatten(deconstructSurface.out1)
code_block_2 = CodeBlock { 0; }
pruneDuplicates = Point.PruneDuplicates(points=flatten, tolerance=code_block_2)
send_to_flux_2 = ToFluxNodeModel(flux_project_2, flow_control_2, pruneDuplicates)
count = List.Count(map)
code_block_3 = CodeBlock(a=count) { 1..a..#a; }
string = StringInput("EL")
python_script = Python(IN[0]=string, IN[1]=count)
# ---------- python_script.python (17 lines) ----------
import clr
clr.AddReference('ProtoGeometry')
from Autodesk.DesignScript.Geometry import *
#The inputs to this node will be stored as a list in the IN variables.

element = UnwrapElement(IN[0])

count = UnwrapElement(IN[1])

text = []

for i in range(1,count):
	text.append(str(element)+str(" ")+str(i))


#Assign your output to the OUT variable.
OUT = text
# ----------------------------------------
