# Dynamo graph Split Multiple Framings.dyn (Dynamo 1.2.0.2514)

# group: STRUCTURAL COLUMN
faces = Element.Faces()  # unwired: arg0
vertices = Face.Vertices(faces)
# note: Search for the corner points of each face of the element geometry.
# The best fitting line through these points represents the location line of the column.
# Though, with this method the Normal vector on the location line is not parallel with the column rotation in case of rotated cross sections. Therefore the Elements.Rotation node, a bit further, will correct this rotation.
# In case of slanted colmuns, the Normal vector can be detected in relation to the cross section rotation.
pointGeometry = Vertex.PointGeometry(vertices)
flatten = Flatten()  # unwired: arg0
map = List.Map(list=pointGeometry, f_x=flatten)
byBestFitThroughPoints = Line.ByBestFitThroughPoints(map)
categories = Categories("StructuralColumns")
all_elements_of_category = ElementsOfCategory(categories)

# group: STRUCTURAL COLUMN LOCAL AXIS DIRECTION
boolean = BoolSelector(false)
reverse = Curve.Reverse(byBestFitThroughPoints)
# note: Reverse section views ?
if_ = If(test=boolean, true=reverse, false=byBestFitThroughPoints)
code_block = CodeBlock { 0; }
# note: Normal vector in local y-dir. The vector needs correction in case of rotated cross sections, this angle is calculated with the Element.RotationAngle node
normalAtParameter = Curve.NormalAtParameter(curve=if_, param=code_block)
direction = Line.Direction(if_)
# note: Get the cross section rotation of the column. In case of slanted columns, the Element.RotationAngle node will return 'null'. This will be replaced afterwards with a 0 angle, as the normal angle can be detected correctly based on the location line direction.
rotationAngle = Custom[Element.RotationAngle](Elements=all_elements_of_category)  # Get the rotation element of a Revit element. The rotation angle is based on the Location.Rotation property in the RevitAPI. If Location is not equal to a LocationPoint (ie. in case of slanted columns) then the Angle will be set to null.
code_block_2 = CodeBlock { 0; }
code_block_3 = CodeBlock { null; }
eq = _ == code_block_3  # unwired: arg0
replaceByCondition = Replace(rotationAngle, code_block_2, eq)
rotate = Vector.Rotate(normalAtParameter, direction, replaceByCondition)
code_block_4 = CodeBlock { 90; }
# note: Normal vector in local z-dir
rotate_2 = Vector.Rotate(rotate, direction, code_block_4)

# note: Select Beams
select_model_elements = DSModelElementsSelection()  # 2 picked in the model
select_model_elements_2 = DSModelElementsSelection()  # 8 picked in the model
code_block_5 = CodeBlock { 1; }
getSurroundingElements = Custom[Tool.GetSurroundingElements](Element=select_model_elements, ElementCheck=select_model_elements_2, Tolerance=code_block_5)  # Get Surrounding Elements by Categories, group them as List. Tolerance distance available.
count = List.Count()  # unwired: arg0
map_2 = List.Map(list=getSurroundingElements, f_x=count)
code_block_6 = CodeBlock { 1; }
gt = map_2 > code_block_6
filterByBoolMask = List.FilterByBoolMask(list=getSurroundingElements, mask=gt)
watch = Watch(filterByBoolMask.in)
code_block_7 = CodeBlock { 0; }
getItemAtIndex = List.GetItemAtIndex(index=code_block_7)  # unwired: list
map_3 = List.Map(list=watch, f_x=getItemAtIndex)
boolean_2 = BoolSelector(true)
python_script = Python(IN[0]=map_3, IN[1]=boolean_2)
# ---------- python_script.python (42 lines) ----------
import clr
clr.AddReference('RevitAPI')
from Autodesk.Revit.DB import *
from System.Collections.Generic import *
clr.AddReference("RevitServices")
import RevitServices
from RevitServices.Persistence import DocumentManager
from RevitServices.Transactions import TransactionManager

doc = DocumentManager.Instance.CurrentDBDocument

#The inputs to this node will be stored as a list in the IN variables.

familyInst = UnwrapElement(IN[0])

bool = IN[1]

modelbeam = []

if bool == True:
	for i in range (0,len(familyInst)):
		TransactionManager.Instance.EnsureInTransaction(doc)
		modelbeam.append(familyInst[i].GetAnalyticalModel())
		#columnCurve = modelbeam[i].GetCurve();
		TransactionManager.Instance.TransactionTaskDone()
else:
	modelbeam="Error"

"""
analyticalModelFrame = familyInst.GetAnalyticalModel()
analyticalCurve = analyticalModelFrame.GetCurve()

amSelector = AnalyticalModelSelector(analyticalCurve)
amSelector.CurveSelector = AnalyticalCurveSelector.WholeCurve
curveReference = analyticalModelFrame.GetReference(amSelector)

amSelector.CurveSelector = AnalyticalCurveSelector.StartPoint;
"""


#Assign your output to the OUT variable.
OUT = modelbeam
# ----------------------------------------
curves = Element.Curves(python_script)
byJoinedCurves = PolyCurve.ByJoinedCurves(curves)
startPoint = Curve.StartPoint(byJoinedCurves)
endPoint = Curve.EndPoint(byJoinedCurves)
byStartPointEndPoint = Line.ByStartPointEndPoint(startPoint=startPoint, endPoint=endPoint)
code_block_8 = CodeBlock { 0; }
getItemAtIndex_2 = List.GetItemAtIndex(list=byStartPointEndPoint, index=code_block_8)
code_block_9 = CodeBlock { 1; }
# note: Select Columns
dropItems = List.DropItems(amount=code_block_9)  # unwired: list
map_4 = List.Map(list=watch, f_x=dropItems)
geometry = Element.Geometry(map_4)
flatten_2 = Flatten()  # unwired: arg0
map_5 = List.Map(list=geometry, f_x=flatten_2)
centroid = Solid.Centroid(map_5)
getItemAtIndex_3 = List.GetItemAtIndex(list=centroid, index=code_block_8)
ZAxis = Vector.ZAxis()
project = Point.Project(getItemAtIndex_3, getItemAtIndex_2, ZAxis)
flatten_3 = Flatten(project)
parameterAtPoint = Curve.ParameterAtPoint(curve=getItemAtIndex_2, point=flatten_3)
splitByParameter = Curve.SplitByParameter(getItemAtIndex_2, parameterAtPoint)
levels = Levels("Level 2")
structural_framing_types = StructuralFramingTypes("UC356x406x287")
beamByCurve = StructuralFraming.BeamByCurve(curve=splitByParameter, level=levels, structuralFramingType=structural_framing_types)

# group: STRUCTURAL COLUMN
faces_2 = Element.Faces()  # unwired: arg0
vertices_2 = Face.Vertices(faces_2)
# note: Search for the corner points of each face of the element geometry.
# The best fitting line through these points represents the location line of the column.
# Though, with this method the Normal vector on the location line is not parallel with the column rotation in case of rotated cross sections. Therefore the Elements.Rotation node, a bit further, will correct this rotation.
# In case of slanted colmuns, the Normal vector can be detected in relation to the cross section rotation.
pointGeometry_2 = Vertex.PointGeometry(vertices_2)
flatten_4 = Flatten()  # unwired: arg0
map_6 = List.Map(list=pointGeometry_2, f_x=flatten_4)
byBestFitThroughPoints_2 = Line.ByBestFitThroughPoints(map_6)

endPoint_2 = Curve.EndPoint(byBestFitThroughPoints_2)
restOfItems = List.RestOfItems(endPoint_2)
byStartPointEndPoint_2 = Line.ByStartPointEndPoint(startPoint=endPoint_2, endPoint=restOfItems)
watch_2 = Watch(filterByBoolMask.in)
compose = ComposeFunctions()  # "Function.Compose"; unwired: arg0, arg1
map_7 = List.Map(f_x=compose)  # unwired: list
