# Dynamo graph Curved Roof Design01.dyn (Dynamo 1.2.0.2514)

# group: Input
select_model_elements = DSModelElementsSelection()  # 2 picked in the model
curves = Element.Curves(select_model_elements)
flatten = Flatten(curves)
number_of_arcs_integer_slider = IntegerSlider(18, range=3..40 step 1)
height_number_slider = DoubleSlider(5.6, range=5.6..12000 step 100)
arc_division_integer_slider = IntegerSlider(12, range=3..30 step 1)

# group: Defintion of the arcs
code_block = CodeBlock(n=number_of_arcs_integer_slider) { 0..1..#n; }
# note: Division of the selected curves with points. The sublists of points will be used later for the 1st and 3rd array of points for the arc creation.
pointAtParameter = Curve.PointAtParameter(curve=flatten, param=code_block, lacing=CrossProduct)
code_block_2 = CodeBlock(lst=pointAtParameter)
# ---------- code_block_2.designscript (4 lines) ----------
//Right points
lst[0];
//Left points
lst[1];
# ----------------------------------------
# note: Connect the division points to detect the middle point between them.
byStartPointEndPoint = Line.ByStartPointEndPoint(startPoint=code_block_2.out0, endPoint=code_block_2.out1)
code_block_3 = CodeBlock { 0.5; }
pointAtParameter_2 = Curve.PointAtParameter(curve=byStartPointEndPoint, param=code_block_3, lacing=Longest)
ZAxis = Vector.ZAxis()
# note: Translate the middle point with the distance equal to the height. This will return the 2nd arc point.
translate = Geometry.Translate(geometry=pointAtParameter_2, direction=ZAxis, distance=height_number_slider)
# note: CURVES FOR ARC BEAM CREATION
byThreePoints = Arc.ByThreePoints(firstPoint=code_block_2.out0, secondPoint=translate, thirdPoint=code_block_2.out1)

# group: Definition of the brace lines
code_block_4 = CodeBlock(n=arc_division_integer_slider) { 0..1..#n; }
# note: Divide the arcs to get the connection points for the horizontal and diagonal braces
pointAtParameter_3 = Curve.PointAtParameter(curve=byThreePoints, param=code_block_4, lacing=CrossProduct)
diagonalRight = List.DiagonalRight(pointAtParameter_3, arc_division_integer_slider)
code_block_5 = CodeBlock(lst=diagonalRight) { {0,List.Count(lst)-1}; }
removeItemAtIndex = List.RemoveItemAtIndex(list=diagonalRight, indices=code_block_5)
# note: Generate a polycurve from these points and discretize this line into its segments for the brace creation.
byPoints = PolyCurve.ByPoints(points=removeItemAtIndex)
# note: CURVES FOR HORIZONTAL BRACE CREATION
curves_2 = PolyCurve.Curves(byPoints)
# note: Transpose the list (rows become columns) to get the sublists of points that are on one horizontal line (for this case).
transpose = List.Transpose(pointAtParameter_3)
code_block_6 = CodeBlock(lst=transpose) { {0,List.Count(lst)-1}; }
# note: Remove the points at the base of the arcs, as they don't need to be connected with braces.
removeItemAtIndex_2 = List.RemoveItemAtIndex(list=transpose, indices=code_block_6)
byPoints_2 = PolyCurve.ByPoints(points=removeItemAtIndex_2)
# note: CURVES FOR DIAGONAL BRACE CREATION
curves_3 = PolyCurve.Curves(byPoints_2)

# group: Visualization of the lines in Dynamo
code_block_7 = CodeBlock()
# ---------- code_block_7.designscript (5 lines) ----------
//Red
a=0;
r=255;
g=0;
b=0;
# ----------------------------------------
byARGB = Color.ByARGB(a=code_block_7.a, r=code_block_7.r, g=code_block_7.g, b=code_block_7.b)
byGeometryColor = Display.Display.ByGeometryColor(byThreePoints, byARGB)
code_block_8 = CodeBlock()
# ---------- code_block_8.designscript (5 lines) ----------
//Green
a=0;
r=0;
g=255;
b=0;
# ----------------------------------------
byARGB_2 = Color.ByARGB(a=code_block_8.a, r=code_block_8.r, g=code_block_8.g, b=code_block_8.b)
byGeometryColor_2 = Display.Display.ByGeometryColor(curves_2, byARGB_2)
code_block_9 = CodeBlock()
# ---------- code_block_9.designscript (5 lines) ----------
//Blue
a=0;
r=0;
g=0;
b=255;
# ----------------------------------------
byARGB_3 = Color.ByARGB(a=code_block_9.a, r=code_block_9.r, g=code_block_9.g, b=code_block_9.b)
byGeometryColor_3 = Display.Display.ByGeometryColor(curves_3, byARGB_3)

# group: Creation of arcs and braces in Revit
# note: Bring all the curves into a list and then dismantle the list in the right order of creation, to correct the auto-join behavior in Revit.
# The main beams need to be created first, then the braces.
create = List.Create(byThreePoints, curves_3, curves_2)
code_block_10 = CodeBlock(lst=create) { lst[0]; lst[1]; lst[2]; }
levels = Levels("Level 1")
structural_framing_types = StructuralFramingTypes()
# note: ARC BEAMS
beamByCurve = StructuralFraming.BeamByCurve(curve=code_block_10.out0, level=levels, structuralFramingType=structural_framing_types)
flatten_2 = Flatten(code_block_10.out1)
structural_framing_types_2 = StructuralFramingTypes()
# note: HORIZONTAL BRACINGS
braceByCurve = StructuralFraming.BraceByCurve(flatten_2, levels, structural_framing_types_2)
structuralframing_disallowjoins = Python(IN[0]=braceByCurve)  # "StructuralFraming.DisallowJoins / Python Script"
# ---------- structuralframing_disallowjoins.python (45 lines) ----------
import clr

# Import RevitAPI
clr.AddReference("RevitAPI")
import Autodesk
from Autodesk.Revit.DB import *

# Import DocumentManager and TransactionManager
clr.AddReference("RevitServices")
import RevitServices
from RevitServices.Persistence import DocumentManager
from RevitServices.Transactions import TransactionManager

# Import ToDSType(bool) extension method
clr.AddReference("RevitNodes")
import Revit
clr.ImportExtensions(Revit.Elements)

# Unwrap
input = UnwrapElement( IN[0] )
elements = []
#force input into list
try:
	for e in input:
		if e.Category.Name == "Structural Framing":
			elements.append(e)
except:
	if input.Category.Name == "Structural Framing": 
		elements.append(input)
	

	
# Start Transaction
doc = DocumentManager.Instance.CurrentDBDocument
TransactionManager.Instance.EnsureInTransaction(doc)

for e in elements:
	Autodesk.Revit.DB.Structure.StructuralFramingUtils.DisallowJoinAtEnd(e, 0)
	Autodesk.Revit.DB.Structure.StructuralFramingUtils.DisallowJoinAtEnd(e, 1)

# End Transaction
TransactionManager.Instance.TransactionTaskDone()

# Wrap
OUT = elements
# ----------------------------------------
flatten_3 = Flatten(code_block_10.out2)
structural_framing_types_3 = StructuralFramingTypes()
# note: DIAGONAL BRACINGS
braceByCurve_2 = StructuralFraming.BraceByCurve(flatten_3, levels, structural_framing_types_3)
# note: With this python script the Auto-Join at the ends of each brace/beam is disabled. If not used the auto-join will generate wrong results in Revit.
# It is also possible to add this python script node into a custom node.
structuralframing_disallowjoins_2 = Python(IN[0]=braceByCurve_2)  # "StructuralFraming.DisallowJoins / Python Script"; same code as structuralframing_disallowjoins
create_2 = List.Create(beamByCurve, structuralframing_disallowjoins, structuralframing_disallowjoins_2)
code_block_11 = CodeBlock { "Structural Material"; }
code_block_12 = CodeBlock { "Steel , S235"; }
byName = Material.ByName(code_block_12)
setParameterByName = Element.SetParameterByName(element=create_2, parameterName=code_block_11, value=byName)
code_block_13 = CodeBlock { "z Justification"; }
code_block_14 = CodeBlock()
# ---------- code_block_14.designscript (2 lines) ----------
//Center
1;
# ----------------------------------------
# note: Set the z Justification of all elements to center.
setParameterByName_2 = Element.SetParameterByName(element=create_2, parameterName=code_block_13, value=code_block_14)

file_path = Filename("..\..\..\..\Desktop\text3.txt")
gsa_header = Custom[GSA Header]()
create_3 = List.Create(removeItemAtIndex_2, removeItemAtIndex)
flatten_4 = Flatten(create_3)
code_block_15 = CodeBlock { 0; }
pruneDuplicates = Point.PruneDuplicates(points=flatten_4, tolerance=code_block_15)
gsa_points = Custom[GSA Points](Points=pruneDuplicates)
flatten_5 = Flatten(curves_3)
flatten_6 = Flatten(curves_2)
byPoints_3 = PolyCurve.ByPoints(points=pointAtParameter_3)
deconstructPolyCurve = Geometry.Curves.DeconstructPolyCurve(byPoints_3)
flatten_7 = Flatten(deconstructPolyCurve)
create_4 = List.Create(flatten_5, flatten_6, flatten_7)
flatten_8 = Flatten(create_4)
code_block_16 = CodeBlock(Curve=flatten_8) { Curve; }
startPoint = Curve.StartPoint(code_block_16)
string_from_object = FromObject(startPoint)
code_block_17 = CodeBlock(Point=pruneDuplicates) { Point; }
string_from_object_2 = FromObject(code_block_17)
indexOf = IndexOf(string_from_object_2)  # unwired: arg1
map = List.Map(list=string_from_object, f_x=indexOf)
string_from_object_3 = FromObject(map)
toNumber = String.ToNumber(string_from_object_3)
code_block_18 = CodeBlock(a=toNumber) { a+1; }
endPoint = Curve.EndPoint(code_block_16)
string_from_object_4 = FromObject(endPoint)
string_from_object_5 = FromObject(code_block_17)
indexOf_2 = IndexOf(string_from_object_5)  # unwired: arg1
map_2 = List.Map(list=string_from_object_4, f_x=indexOf_2)
string_from_object_6 = FromObject(map_2)
toNumber_2 = String.ToNumber(string_from_object_6)
code_block_19 = CodeBlock(a=toNumber_2) { a+1; }
code_block_20 = CodeBlock { "3"; "1"; "2"; }
create_5 = List.Create(code_block_20.out0, code_block_20.out1, code_block_20.out2)
python_script = Python(IN[0]=create_4, IN[1]=create_5)
# ---------- python_script.python (22 lines) ----------
import clr
clr.AddReference('ProtoGeometry')
from Autodesk.DesignScript.Geometry import *
#The inputs to this node will be stored as a list in the IN variables.
Lists = UnwrapElement(IN[0])
Param = UnwrapElement(IN[1])

count = []

Pm = []

for item in Lists:
	count.append(len(item))

for i in range(0,len(count)):
    co = 0
    while co<count[i]:
        Pm.append(Param[i])
        co = co+1

#Assign your output to the OUT variable.
OUT = Pm
# ----------------------------------------
python_script_2 = Python(IN[0]=code_block_18, IN[1]=code_block_19, IN[2]=python_script)
# ---------- python_script_2.python (20 lines) ----------
import clr
clr.AddReference('ProtoGeometry')
from Autodesk.DesignScript.Geometry import *
#The inputs to this node will be stored as a list in the IN variables.

stPoint = UnwrapElement(IN[0])
endPoint = UnwrapElement(IN[1])
ElProp = UnwrapElement(IN[2])
elcounter = 0

text = []

for i in range(0,len(stPoint)):
    elcounter = elcounter +1
    text.append("EL	" + str(elcounter) +"		NO_RGB	BEAM	" + str(ElProp[i]) + "	1	" + str(stPoint[i]) + "	" + str(endPoint[i]))
    


#Assign your output to the OUT variable.
OUT = text
# ----------------------------------------
string_from_array = FromArray(python_script_2)
code_block_21 = CodeBlock { "{"; }
string = StringInput("")
replace = String.Replace(str=string_from_array, searchFor=code_block_21, replaceWith=string)
string_2 = StringInput(",")
string_3 = StringInput("\n")
replace_2 = String.Replace(str=replace, searchFor=string_2, replaceWith=string_3)
code_block_22 = CodeBlock { "}"; }
replace_3 = String.Replace(str=replace_2, searchFor=code_block_22, replaceWith=string)
gsa_el_properties = Custom[GSA EL Properties]()
gsa_footers = Custom[GSA Footers]()
create_6 = List.Create(gsa_header, gsa_points, replace_3, gsa_el_properties, gsa_footers)
writeToFile = CSV.WriteToFile(file_path, create_6)
