# Dynamo graph GSA Floors04.dyn (Dynamo 1.2.1.3083)

file_path = Filename("..\..\..\..\Desktop\Test.txt")
gsa_header = Custom[GSA Header]()

# group: INPUT: ANALYTICAL FLOOR
select_model_element = DSModelElementSelection()  # 1 picked in the model

geometry = Element.Geometry(select_model_element)
code_block = CodeBlock(gt=geometry) { gt[0]; }
perimeterCurves = Surface.PerimeterCurves(code_block)
code_block_2 = CodeBlock(a=perimeterCurves) { Count(a); }

# group: INPUT: VOIDS
in_voids_number = CodeBlock { 20; }
in_voids_edges = CodeBlock { 4; }

code_block_3 = CodeBlock(a=in_voids_number, b=in_voids_edges) { a*b; }
code_block_4 = CodeBlock(a=code_block_2, b=code_block_3) { a-b; }
split = Custom[List.Split](list=perimeterCurves, amount=code_block_4)  # Splits a list at the desired length
simplify = Custom[CurveLoop.Simplify](curveLoop=split.list1)  # Attempts to simplify an open or a closed curve loop by connecting straight separate line segments into a single line.
length = Curve.Length(split.list1)

# group: INPUT: QUAD 4 PANEL SIZE
code_block_5 = CodeBlock { 1; }

code_block_6 = CodeBlock(a=length, b=code_block_5) { a/b; }
ceiling = Math.Ceiling(code_block_6)
pointsAtEqualSegmentLength = Curve.PointsAtEqualSegmentLength(curve=split.list1, divisions=ceiling)
splitByPoints = Curve.SplitByPoints(curve=simplify, points=pointsAtEqualSegmentLength)
flatten = Flatten(splitByPoints)
chop = List.Chop(list=split.list2, lengths=in_voids_edges)
length_2 = Curve.Length(chop)
code_block_7 = CodeBlock(a=length_2, b=code_block_5) { a/b; }
ceiling_2 = Math.Ceiling(code_block_7)
pointsAtEqualSegmentLength_2 = Curve.PointsAtEqualSegmentLength(curve=chop, divisions=ceiling_2)
splitByPoints_2 = Curve.SplitByPoints(curve=chop, points=pointsAtEqualSegmentLength_2)
create = List.Create(perimeterCurves, flatten, splitByPoints_2)
flatten_2 = Flatten(create)
removeNulls = Lists.Manage.RemoveNulls(flatten_2)
py_extract_points = Python(IN[0]=removeNulls)
# ---------- py_extract_points.python (14 lines) ----------
import clr
clr.AddReference('ProtoGeometry')
from Autodesk.DesignScript.Geometry import *
#The inputs to this node will be stored as a list in the IN variables.
Curves = UnwrapElement(IN[0])

pts = []

for crv in Curves:
	pts.append(crv.StartPoint)
	pts.append(crv.EndPoint)

#Assign your output to the OUT variable.
OUT = pts
# ----------------------------------------
select_model_elements = DSModelElementsSelection()  # 16 picked in the model
geometry_2 = Element.Geometry(select_model_elements)

# group: COLUMNS
gsa_create_analytical_sticks = Custom[GSA Create Analytical Sticks](Revit_Element=geometry_2)

create_2 = List.Create(py_extract_points, gsa_create_analytical_sticks.Start_Points, gsa_create_analytical_sticks.End_Points)
flatten_3 = Flatten(create_2)

# group: GSA POINTS
gsa_points = Custom[GSA Points](Points=flatten_3)

flatten_4 = Flatten(splitByPoints_2)
group_curves = Custom[Group Curves](Curves=flatten_4)  # This node will take any input of flat list of curves and group them into sublists containing "joinable" curves that is continous curves. They might form closed curves or open curves. Use PolyCurve.ByJoinedCurves to convert output groups of curves into single PolyCurves
simplify_2 = Custom[CurveLoop.Simplify](curveLoop=group_curves)
create_3 = List.Create(flatten, simplify_2, gsa_create_analytical_sticks.Elements)

# group: GSA LINES
gsa_lines = Custom[GSA Lines](Point=flatten_3, Curve=create_3)

# group: FLOOR AREA
code_block_8 = CodeBlock { "TWO_WAY"; }
code_block_9 = CodeBlock { 0; }
gsa_area = Custom[GSA Area](AreaType=code_block_8, Element_Counter=code_block_9, Boundary_Lines=flatten, Point_List=flatten_3)

code_block_10 = CodeBlock(a=flatten) { Count(a); }

# group: VOID AREA
code_block_11 = CodeBlock { 10; }
gsa_void_area = Custom[GSA Void Area](Boundary_Lines=simplify_2, Point_List=py_extract_points, Area_Counter=code_block_11, Lines_Counter=code_block_10)

join = List.Join(gsa_area, gsa_void_area)
string_from_array = FromArray(join)
py_string_replace = Python(IN[0]=string_from_array)
# ---------- py_string_replace.python (14 lines) ----------
import clr
clr.AddReference('ProtoGeometry')
from Autodesk.DesignScript.Geometry import *
#The inputs to this node will be stored as a list in the IN variables.
text = IN[0]

text1= text.strip("{")

text2=text1.strip("}")

text3=text2.replace(",","")

#Assign your output to the OUT variable.
OUT = text3
# ----------------------------------------
flatten_5 = Flatten(join)
python_script = Python(IN[0]=flatten_5)
# ---------- python_script.python (21 lines) ----------
import re
import operator
import clr
clr.AddReference('ProtoGeometry')
from Autodesk.DesignScript.Geometry import *
#The inputs to this node will be stored as a list in the IN variables.

hand = IN[0]

values=[]
 
for line in hand:
	b = line.rstrip()
	values.append(re.findall("AREA	([0-9]+)",b))




OUT = values

    
# ----------------------------------------
flatten_6 = Flatten(python_script)
string_from_array_2 = FromArray(flatten_6)

# group: GSA REGION
gsa_region_definition = Custom[GSA Region Definition](Points=flatten_3, Fixed_Nodes=gsa_create_analytical_sticks.End_Points)
# note: Areas
python_script_2 = Python(IN[0]=string_from_array_2)
# ---------- python_script_2.python (14 lines) ----------
import clr
clr.AddReference('ProtoGeometry')
from Autodesk.DesignScript.Geometry import *
#The inputs to this node will be stored as a list in the IN variables.
text = IN[0]

text1= text.strip("{")

text2=text1.strip("}")

text3=text2.replace(","," ")

#Assign your output to the OUT variable.
OUT = text3
# ----------------------------------------
# note: Fixed Nodes
py_region = Python(IN[0]=gsa_region_definition.Fixed_Nodes, IN[1]=python_script_2)
# ---------- py_region.python (10 lines) ----------
import clr
clr.AddReference('ProtoGeometry')
from Autodesk.DesignScript.Geometry import *
#The inputs to this node will be stored as a list in the IN variables.

Nodes = IN[0]
Areas = IN[1]


OUT = "REGION	1		NO_RGB	0	2D_MESH	" + str(Nodes) + "		" + str(Areas) + "	CM2_MESHTOOLS	YES	YES	YES	8	0.000000	0.500000	0.600000	QUAD8	NO	NO	NO	1.00000"
# ----------------------------------------

code_block_12 = CodeBlock { "0"; }
gsa_grid_plane = Custom[GSA Grid Plane](Elevation=code_block_12)
select_rooms = DSModelElementsSelection()  # 9 picked in the model
code_block_13 = CodeBlock { 0; }
gsa_room_to_load_areas = Custom[GSA Room to Load Areas](Rooms=select_rooms, Polyline_Counter=code_block_13)
gsa_footers = Custom[GSA Footers]()
create_4 = List.Create(gsa_header, gsa_points, gsa_lines, py_string_replace, py_region, gsa_grid_plane, gsa_room_to_load_areas.2D_Polyline, gsa_room_to_load_areas.Grid_Area_Loads, gsa_footers)
writeToFile = CSV.WriteToFile(file_path, create_4)
