# Dynamo graph GSA Arc Standard.dyn (Dynamo 1.2.0.2514)

file_path = Filename("..\..\..\..\Desktop\Test.txt")
gsa_header = Custom[GSA Header]()
select_model_elements = DSModelElementsSelection()  # 591 picked in the model
geometry = Element.Geometry(select_model_elements)
code_block = CodeBlock { "Arc"; }
byClassName = Custom[Filter.ByClassName](object_s=geometry, Class_name_s=code_block, lacing=Longest)  # Filters a list of objects by the object's class name. Note that Dynamo elements belong to different classes than their Revit counterparts. Use the Object.Class node to check an object's class.
clean = List.Clean(list=byClassName.in)
isEmpty = List.IsEmpty(clean, lacing=Longest)
filterByBoolMask = List.FilterByBoolMask(list=clean, mask=isEmpty)
CP = Python(IN[0]=filterByBoolMask.out)
# ---------- CP.python (20 lines) ----------
import clr
clr.AddReference('ProtoGeometry')
from Autodesk.DesignScript.Geometry import *
#The inputs to this node will be stored as a list in the IN variables.
triarc = IN[0]

CP = []

for arc in triarc:
	CP.append(arc[2].CenterPoint)

OUT = CP





#Assign your output to the OUT variable.

#OUT = triarc[1].CenterPoint,triarc[1].Radius,triarc[1].StartAngle,triarc[1].SweepAngle,triarc[1].Normal
# ----------------------------------------
startPoint = Python(IN[0]=filterByBoolMask.out)
# ---------- startPoint.python (20 lines) ----------
import clr
clr.AddReference('ProtoGeometry')
from Autodesk.DesignScript.Geometry import *
#The inputs to this node will be stored as a list in the IN variables.
triarc = IN[0]

StPoint = []

for arc in triarc:
	StPoint.append(arc[0].StartPoint)

OUT = StPoint





#Assign your output to the OUT variable.

#OUT = triarc[1].CenterPoint,triarc[1].Radius,triarc[1].StartAngle,triarc[1].SweepAngle,triarc[1].Normal
# ----------------------------------------
sweepAngle = Python(IN[0]=filterByBoolMask.out)
# ---------- sweepAngle.python (20 lines) ----------
import clr
clr.AddReference('ProtoGeometry')
from Autodesk.DesignScript.Geometry import *
#The inputs to this node will be stored as a list in the IN variables.
triarc = IN[0]

SwAngle = []

for arc in triarc:
	SwAngle.append(arc[0].SweepAngle+arc[1].SweepAngle+arc[2].SweepAngle)

OUT = SwAngle





#Assign your output to the OUT variable.

#OUT = triarc[1].CenterPoint,triarc[1].Radius,triarc[1].StartAngle,triarc[1].SweepAngle,triarc[1].Normal
# ----------------------------------------
normal = Python(IN[0]=filterByBoolMask.out)
# ---------- normal.python (20 lines) ----------
import clr
clr.AddReference('ProtoGeometry')
from Autodesk.DesignScript.Geometry import *
#The inputs to this node will be stored as a list in the IN variables.
triarc = IN[0]

Nrm = []

for arc in triarc:
	Nrm.append(arc[1].Normal)

OUT = Nrm





#Assign your output to the OUT variable.

#OUT = triarc[1].CenterPoint,triarc[1].Radius,triarc[1].StartAngle,triarc[1].SweepAngle,triarc[1].Normal
# ----------------------------------------
byCenterPointStartPointSweepAngle = Arc.ByCenterPointStartPointSweepAngle(CP, startPoint, sweepAngle, normal)
select_model_elements_2 = DSModelElementsSelection()  # 13 picked in the model
geometry_2 = Element.Geometry(select_model_elements_2)
flatten = Flatten(geometry_2)
code_block_2 = CodeBlock { "Point"; }
byClassName_2 = Custom[Filter.ByClassName](object_s=flatten, Class_name_s=code_block_2)
splitByPoints = Curve.SplitByPoints(curve=byCenterPointStartPointSweepAngle, points=byClassName_2.in)
flatten_2 = Flatten(splitByPoints)
startPoint_2 = Curve.StartPoint(flatten_2)
endPoint = Curve.EndPoint(flatten_2)
create = List.Create(startPoint_2, endPoint)
flatten_3 = Flatten(create)
gsa_points = Custom[GSA Points](Points=flatten_3)
gsa_beam_elements = Custom[GSA Beam Elements](GSA_Point_List=flatten_3, Start_Points=startPoint_2, End_Points=endPoint)
gsa_footers = Custom[GSA Footers]()
create_2 = List.Create(gsa_header, gsa_points, gsa_beam_elements, gsa_footers)
writeToFile = CSV.WriteToFile(file_path, create_2)
flatten_4 = Flatten(geometry)
code_block_3 = CodeBlock { "Arc"; }
byClassName_3 = Custom[Filter.ByClassName](object_s=flatten_4, Class_name_s=code_block_3)
watch = Watch(filterByBoolMask.out)
R = Python(IN[0]=filterByBoolMask.out)
# ---------- R.python (20 lines) ----------
import clr
clr.AddReference('ProtoGeometry')
from Autodesk.DesignScript.Geometry import *
#The inputs to this node will be stored as a list in the IN variables.
triarc = IN[0]

R = []

for arc in triarc:
	R.append(arc[2].Radius)

OUT = R





#Assign your output to the OUT variable.

#OUT = triarc[1].CenterPoint,triarc[1].Radius,triarc[1].StartAngle,triarc[1].SweepAngle,triarc[1].Normal
# ----------------------------------------
startAngle = Python(IN[0]=filterByBoolMask.out)
# ---------- startAngle.python (20 lines) ----------
import clr
clr.AddReference('ProtoGeometry')
from Autodesk.DesignScript.Geometry import *
#The inputs to this node will be stored as a list in the IN variables.
triarc = IN[0]

StAngle = []

for arc in triarc:
	StAngle.append(arc[2].StartAngle)

OUT = StAngle





#Assign your output to the OUT variable.

#OUT = triarc[1].CenterPoint,triarc[1].Radius,triarc[1].StartAngle,triarc[1].SweepAngle,triarc[1].Normal
# ----------------------------------------
byBestFitThroughPoints = Arc.ByBestFitThroughPoints(byClassName_2.in)
watch_2 = Watch(byBestFitThroughPoints)
code_block_4 = CodeBlock { 0; }
