# Dynamo graph GSA Arcs01.dyn (Dynamo 1.2.0.2514)

file_path = Filename("..\..\..\..\Desktop\Test.txt")
gsa_header = Custom[GSA Header]()
select_model_elements = DSModelElementsSelection()  # 591 picked in the model
geometry = Element.Geometry(select_model_elements)
flatten = Flatten(geometry)
string_from_object = FromObject(flatten)
code_block = CodeBlock { "Line"; }
contains = String.Contains(str=string_from_object, searchFor=code_block)
filterByBoolMask = List.FilterByBoolMask(list=flatten, mask=contains)
code_block_2 = CodeBlock { 3; }
chop = List.Chop(list=filterByBoolMask.in, lengths=code_block_2)
py_join_curves = Python(IN[0]=chop)
# ---------- py_join_curves.python (17 lines) ----------
import clr
clr.AddReference('ProtoGeometry')
from Autodesk.DesignScript.Geometry import *
#The inputs to this node will be stored as a list in the IN variables.

crvs = UnwrapElement(IN[0])

crv = []

for i in range(0,len(crvs)):
	crv.append(PolyCurve.ByJoinedCurves(crvs[i]))
	



#Assign your output to the OUT variable.
OUT = crv
# ----------------------------------------
string_from_object_2 = FromObject(flatten)
code_block_3 = CodeBlock { "Arc"; }
contains_2 = String.Contains(str=string_from_object_2, searchFor=code_block_3)
filterByBoolMask_2 = List.FilterByBoolMask(list=flatten, mask=contains_2)
chop_2 = List.Chop(list=filterByBoolMask_2.in, lengths=code_block_2)
py_join_curves_2 = Python(IN[0]=chop_2)  # same code as py_join_curves
create = List.Create(py_join_curves_2)
flatten_2 = Flatten(create)
code_block_4 = CodeBlock { 0..1..#60; }
pointAtParameter = Curve.PointAtParameter(curve=flatten_2, param=code_block_4, lacing=CrossProduct)
byBestFitThroughPoints = Arc.ByBestFitThroughPoints(pointAtParameter, lacing=Longest)
py_join_curves_3 = Python(IN[0]=chop)  # same code as py_join_curves
startPoint = Curve.StartPoint(py_join_curves_3)
endPoint = Curve.EndPoint(py_join_curves_3)
create_2 = List.Create(startPoint, endPoint)
flatten_3 = Flatten(create_2)
code_block_5 = CodeBlock { 0; }
pruneDuplicates = Point.PruneDuplicates(points=flatten_3, tolerance=code_block_5)
intersectAll = Geometry.IntersectAll(geometry=byBestFitThroughPoints, others=pruneDuplicates, lacing=CrossProduct)
flatten_4 = Flatten(intersectAll)
pruneDuplicates_2 = Point.PruneDuplicates(points=flatten_4, tolerance=code_block_5)
splitByPoints = Curve.SplitByPoints(curve=byBestFitThroughPoints, points=pruneDuplicates_2)
create_3 = List.Create(py_join_curves, splitByPoints)
flatten_5 = Flatten(create_3)
startPoint_2 = Curve.StartPoint(flatten_5)
endPoint_2 = Curve.EndPoint(flatten_5)
create_4 = List.Create(startPoint_2, endPoint_2)
flatten_6 = Flatten(create_4)
gsa_points = Custom[GSA Points](Points=flatten_6)
gsa_beam_elements = Custom[GSA Beam Elements](GSA_Point_List=flatten_6, Start_Points=startPoint_2, End_Points=endPoint_2)
gsa_footers = Custom[GSA Footers]()
create_5 = List.Create(gsa_header, gsa_points, gsa_beam_elements, gsa_footers)
writeToFile = CSV.WriteToFile(file_path, create_5)
code_block_6 = CodeBlock { 1; }
getItemAtIndex = List.GetItemAtIndex(list=py_join_curves_2, index=code_block_6)
flatten_7 = Flatten(geometry)
class_ = Custom[Object.Class](obj=flatten_7)  # Gets the input object's class name. Can process lists.
string_from_object_3 = FromObject(class_.class_str)
code_block_7 = CodeBlock { "Point"; }
contains_3 = String.Contains(str=string_from_object_3, searchFor=code_block_7)
filterByBoolMask_3 = List.FilterByBoolMask(list=flatten_7, mask=contains_3)
code_block_8 = CodeBlock { 0; }
pruneDuplicates_3 = Point.PruneDuplicates(points=filterByBoolMask_3.in, tolerance=code_block_8)
