# Dynamo graph GSA Bay Line and Arcs 01.dyn (Dynamo 1.2.0.2514)

select_model_elements = DSModelElementsSelection()  # 23 picked in the model
geometry = Element.Geometry(select_model_elements)
flatten = Flatten(geometry)
code_block = CodeBlock { "Line"; }
byClassName = Custom[Filter.ByClassName](object_s=flatten, Class_name_s=code_block)  # Filters a list of objects by the object's class name. Note that Dynamo elements belong to different classes than their Revit counterparts. Use the Object.Class node to check an object's class.
code_block_2 = CodeBlock { 3; }
chop = List.Chop(list=byClassName.out, lengths=code_block_2)
py_join_curves = Python(IN[0]=chop)
# ---------- py_join_curves.python (17 lines) ----------
import clr
clr.AddReference('ProtoGeometry')
from Autodesk.DesignScript.Geometry import *
#The inputs to this node will be stored as a list in the IN variables.

crvs = UnwrapElement(IN[0])

crv = []

for i in range(0,len(crvs)):
	crv.append(PolyCurve.ByJoinedCurves(crvs[i]))
	



#Assign your output to the OUT variable.
OUT = crv
# ----------------------------------------
restOfItems = List.RestOfItems(py_join_curves)
code_block_3 = CodeBlock { 40; }
code_block_4 = CodeBlock(a=code_block_3) { 0..1..#a; }
pointAtParameter = Curve.PointAtParameter(curve=restOfItems, param=code_block_4, lacing=Longest)
byBestFitThroughPoints = Arc.ByBestFitThroughPoints(pointAtParameter)
chop_2 = List.Chop(list=byClassName.in, lengths=code_block_2)
py_join_curves_2 = Python(IN[0]=chop_2)  # same code as py_join_curves
intersect = Geometry.Intersect(geometry=byBestFitThroughPoints, other=py_join_curves_2)
flatten_2 = Flatten(intersect)
code_block_5 = CodeBlock { 0; }
pruneDuplicates = Point.PruneDuplicates(points=flatten_2, tolerance=code_block_5)
splitByPoints = Curve.SplitByPoints(curve=byBestFitThroughPoints, points=pruneDuplicates)
file_path = Filename("..\..\..\..\Desktop\Test.txt")
gsa_header = Custom[GSA Header]()
py_point_at_parameter = Python(IN[0]=py_join_curves, IN[1]=code_block_4)
# ---------- py_point_at_parameter.python (19 lines) ----------
import clr
clr.AddReference('ProtoGeometry')
from Autodesk.DesignScript.Geometry import *
#The inputs to this node will be stored as a list in the IN variables.

crvs = UnwrapElement(IN[0])
pts = UnwrapElement(IN[1])

crv = []

for cr in crvs:
	for i in range(0,len(pts)):
		crv.append(PolyCurve.PointAtParameter(cr,pts[i]))
	



#Assign your output to the OUT variable.
OUT = crv
# ----------------------------------------
chop_3 = List.Chop(list=py_point_at_parameter, lengths=code_block_3)
byBestFitThroughPoints_2 = Arc.ByBestFitThroughPoints(chop_3)
py_geometry_intersect = Python(IN[0]=byBestFitThroughPoints_2, IN[1]=py_join_curves_2)
# ---------- py_geometry_intersect.python (24 lines) ----------
import clr
clr.AddReference('ProtoGeometry')
from Autodesk.DesignScript.Geometry import *
#The inputs to this node will be stored as a list in the IN variables.

crvs = UnwrapElement(IN[0])
others = UnwrapElement(IN[1])

crv = []

for i in range(0,len(others)):
	for j in range(0,len(crvs)):
		crv.append(Geometry.Intersect(crvs[j],others[i]))

"""
for cr in crvs:
	for ot in others:
		crv.append(Geometry.Intersect(cr,ot))
"""	



#Assign your output to the OUT variable.
OUT = crv
# ----------------------------------------
flatten_3 = Flatten(py_geometry_intersect)
pruneDuplicates_2 = Point.PruneDuplicates(points=flatten_3, tolerance=code_block_5)
code_block_6 = CodeBlock(a=pruneDuplicates_2) { Count(a)/2; }
chop_4 = List.Chop(list=pruneDuplicates_2, lengths=code_block_6)
splitByPoints_2 = Curve.SplitByPoints(curve=byBestFitThroughPoints_2, points=chop_4)
create = List.Create(splitByPoints_2, py_join_curves_2)
flatten_4 = Flatten(create)
startPoint = Curve.StartPoint(flatten_4)
endPoint = Curve.EndPoint(flatten_4)
create_2 = List.Create(startPoint, endPoint)
flatten_5 = Flatten(create_2)
gsa_points = Custom[GSA Points](Points=flatten_5)
gsa_beam_elements = Custom[GSA Beam Elements](GSA_Point_List=flatten_5, Start_Points=startPoint, End_Points=endPoint)
gsa_footers = Custom[GSA Footers]()
create_3 = List.Create(gsa_header, gsa_points, gsa_beam_elements, gsa_footers)
writeToFile = CSV.WriteToFile(file_path, create_3)
code_block_7 = CodeBlock { Autodesk.Geometry.Intersect(); }
