# Dynamo graph GSA Bay Line and Arcs 02.dyn (Dynamo 1.2.0.2514)

select_model_elements = DSModelElementsSelection()  # 591 picked in the model
geometry = Element.Geometry(select_model_elements)
flatten = Flatten(geometry)
code_block = CodeBlock { "Line"; }
byClassName = Custom[Filter.ByClassName](object_s=flatten, Class_name_s=code_block)  # Filters a list of objects by the object's class name. Note that Dynamo elements belong to different classes than their Revit counterparts. Use the Object.Class node to check an object's class.
code_block_2 = CodeBlock { 3; }
chop = List.Chop(list=byClassName.out, lengths=code_block_2)
file_path = Filename("..\..\..\..\Desktop\Test.txt")
gsa_header = Custom[GSA Header]()
flatten_2 = Flatten()  # unwired: arg0
startPoint = Curve.StartPoint(flatten_2)
endPoint = Curve.EndPoint(flatten_2)
create = List.Create(startPoint, endPoint)
flatten_3 = Flatten(create)
gsa_points = Custom[GSA Points](Points=flatten_3)
gsa_beam_elements = Custom[GSA Beam Elements](GSA_Point_List=flatten_3, Start_Points=startPoint, End_Points=endPoint)
gsa_footers = Custom[GSA Footers]()
create_2 = List.Create(gsa_header, gsa_points, gsa_beam_elements, gsa_footers)
writeToFile = CSV.WriteToFile(file_path, create_2)
startPoint_2 = Curve.StartPoint()  # unwired: arg0
code_block_3 = CodeBlock { 0; }
pruneDuplicates = Point.PruneDuplicates(points=startPoint_2, tolerance=code_block_3)
byPoints = PolyCurve.ByPoints(points=pruneDuplicates)
endPoint_2 = Curve.EndPoint()  # unwired: arg0
pruneDuplicates_2 = Point.PruneDuplicates(points=endPoint_2, tolerance=code_block_3)
byPoints_2 = PolyCurve.ByPoints(points=pruneDuplicates_2)
code_block_4 = CodeBlock { 3; }
chop_2 = List.Chop(list=byClassName.in, lengths=code_block_2)
py_join_curves = Python(IN[0]=chop_2)
# ---------- py_join_curves.python (17 lines) ----------
import clr
clr.AddReference('ProtoGeometry')
from Autodesk.DesignScript.Geometry import *
#The inputs to this node will be stored as a list in the IN variables.

crvs = UnwrapElement(IN[0])

crv = []

for i in range(0,len(crvs)):
	crv.append(PolyCurve.ByJoinedCurves(crvs[i]))
	



#Assign your output to the OUT variable.
OUT = crv
# ----------------------------------------
