# Dynamo graph GSA Bay Line and Arcs04.dyn (Dynamo 1.2.0.2514)

file_path = Filename("..\..\..\..\Desktop\text3.txt")
gsa_header = Custom[GSA Header]()
select_model_elements = DSModelElementsSelection()  # 45 picked in the model
geometry = Element.Geometry(select_model_elements)
flatten = Flatten(geometry)
code_block = CodeBlock { "Line"; }
byClassName = Custom[Filter.ByClassName](object_s=flatten, Class_name_s=code_block)  # Filters a list of objects by the object's class name. Note that Dynamo elements belong to different classes than their Revit counterparts. Use the Object.Class node to check an object's class.
code_block_2 = CodeBlock { 3; }
chop = List.Chop(list=byClassName.in, lengths=code_block_2)
py_join_curves = Python(IN[0]=chop)
# ---------- py_join_curves.python (17 lines) ----------
import clr
clr.AddReference('ProtoGeometry')
from Autodesk.DesignScript.Geometry import *
#The inputs to this node will be stored as a list in the IN variables.

crvs = UnwrapElement(IN[0])

crv = []

for i in range(0,len(crvs)):
	crv.append(PolyCurve.ByJoinedCurves(crvs[i]))
	



#Assign your output to the OUT variable.
OUT = crv
# ----------------------------------------
chop_2 = List.Chop(list=byClassName.out, lengths=code_block_2)
py_join_curves_2 = Python(IN[0]=chop_2)  # same code as py_join_curves
code_block_3 = CodeBlock { 40; }
code_block_4 = CodeBlock(a=code_block_3) { 0..1..#a; }
py_point_at_parameter = Python(IN[0]=py_join_curves_2, IN[1]=code_block_4)
# ---------- py_point_at_parameter.python (19 lines) ----------
import clr
clr.AddReference('ProtoGeometry')
from Autodesk.DesignScript.Geometry import *
#The inputs to this node will be stored as a list in the IN variables.

crvs = UnwrapElement(IN[0])
pts = UnwrapElement(IN[1])

crv = []

for cr in crvs:
	for i in range(0,len(pts)):
		crv.append(PolyCurve.PointAtParameter(cr,pts[i]))
	



#Assign your output to the OUT variable.
OUT = crv
# ----------------------------------------
chop_3 = List.Chop(list=py_point_at_parameter, lengths=code_block_3)
byBestFitThroughPoints = Arc.ByBestFitThroughPoints(chop_3)
py_join_curves_3 = Python(IN[0]=chop_2)  # same code as py_join_curves
intersectAll = Geometry.IntersectAll(geometry=py_join_curves, others=py_join_curves_3, lacing=CrossProduct)
flatten_2 = Flatten(intersectAll)
code_block_5 = CodeBlock { 0; }
pruneDuplicates = Point.PruneDuplicates(points=flatten_2, tolerance=code_block_5)
create = List.Create(pruneDuplicates)
py_split_by_points = Python(IN[0]=byBestFitThroughPoints, IN[1]=create)
# ---------- py_split_by_points.python (19 lines) ----------
import clr
clr.AddReference('ProtoGeometry')
from Autodesk.DesignScript.Geometry import *
#The inputs to this node will be stored as a list in the IN variables.

crvs = UnwrapElement(IN[0])
pts = UnwrapElement(IN[1])

crv = []

for i in range(0,len(pts)):
	for j in range(0,len(crvs)):
		crv.append(Arc.SplitByPoints(crvs[j],pts[i]))
	



#Assign your output to the OUT variable.
OUT = crv
# ----------------------------------------
create_2 = List.Create(py_join_curves, py_split_by_points)
flatten_3 = Flatten(create_2)
startPoint = Curve.StartPoint(flatten_3)
endPoint = Curve.EndPoint(flatten_3)
create_3 = List.Create(startPoint, endPoint)
flatten_4 = Flatten(create_3)
code_block_6 = CodeBlock { 0; }
pruneDuplicates_2 = Point.PruneDuplicates(points=flatten_4, tolerance=code_block_6)
gsa_points = Custom[GSA Points](Points=pruneDuplicates_2)
gsa_beam_elements = Custom[GSA Beam Elements](GSA_Point_List=pruneDuplicates_2, Start_Points=startPoint, End_Points=endPoint)
gsa_footers = Custom[GSA Footers]()
create_4 = List.Create(gsa_header, gsa_points, gsa_beam_elements, gsa_footers)
writeToFile = CSV.WriteToFile(file_path, create_4)
code_block_7 = CodeBlock { 3; }
code_block_8 = CodeBlock { 0; }
takeEveryNthItem = List.TakeEveryNthItem(pruneDuplicates, code_block_7, code_block_8)
byPoints = PolyCurve.ByPoints(points=takeEveryNthItem)
code_block_9 = CodeBlock { 1; }
takeEveryNthItem_2 = List.TakeEveryNthItem(pruneDuplicates, code_block_7, code_block_9)
byPoints_2 = PolyCurve.ByPoints(points=takeEveryNthItem_2)
code_block_10 = CodeBlock { 2; }
takeEveryNthItem_3 = List.TakeEveryNthItem(pruneDuplicates, code_block_7, code_block_10)
byPoints_3 = PolyCurve.ByPoints(points=takeEveryNthItem_3)
