# Dynamo graph GSA Floors.dyn (Dynamo 1.2.0.2514)

file_path = Filename("..\..\..\..\Desktop\Test.txt")
gsa_header = Custom[GSA Header]()
select_model_element = DSModelElementSelection()  # 1 picked in the model
geometry = Element.Geometry(select_model_element)
code_block = CodeBlock(gt=geometry) { gt[0]; }
perimeterCurves = Surface.PerimeterCurves(code_block)
py_extract_points = Python(IN[0]=perimeterCurves)
# ---------- py_extract_points.python (14 lines) ----------
import clr
clr.AddReference('ProtoGeometry')
from Autodesk.DesignScript.Geometry import *
#The inputs to this node will be stored as a list in the IN variables.
Curves = UnwrapElement(IN[0])

pts = []

for crv in Curves:
	pts.append(crv.StartPoint)
	pts.append(crv.EndPoint)

#Assign your output to the OUT variable.
OUT = pts
# ----------------------------------------
gsa_points = Custom[GSA Points](Points=py_extract_points)
code_block_2 = CodeBlock(a=perimeterCurves) { Count(a); }
in_voids_number = CodeBlock { 3; }
in_voids_edges = CodeBlock { 4; }
code_block_3 = CodeBlock(a=in_voids_number, b=in_voids_edges) { a*b; }
code_block_4 = CodeBlock(a=code_block_2, b=code_block_3) { a-b; }
split = Custom[List.Split](list=perimeterCurves, amount=code_block_4)  # Splits a list at the desired length

# group: SLAB
simplify = Custom[CurveLoop.Simplify](curveLoop=split.list1)  # Attempts to simplify an open or a closed curve loop by connecting straight separate line segments into a single line.

# group: VOIDS
chop = List.Chop(list=split.list2, lengths=in_voids_edges)

create = List.Create(simplify, chop)
gsa_lines = Custom[GSA Lines](Point=py_extract_points, Curve=create)
code_block_5 = CodeBlock(Curve=simplify) { Curve; }
flatten = Flatten(code_block_5)
startPoint = Curve.StartPoint(flatten)
string_from_object = FromObject(startPoint)
code_block_6 = CodeBlock(Point=py_extract_points) { Point; }
string_from_object_2 = FromObject(code_block_6)
indexOf = IndexOf(string_from_object_2)  # unwired: arg1
map = List.Map(list=string_from_object, f_x=indexOf)
string_from_object_3 = FromObject(map)
toNumber = String.ToNumber(string_from_object_3)
code_block_7 = CodeBlock(a=toNumber) { a+1; }
endPoint = Curve.EndPoint(flatten)
string_from_object_4 = FromObject(endPoint)
string_from_object_5 = FromObject(code_block_6)
indexOf_2 = IndexOf(string_from_object_5)  # unwired: arg1
map_2 = List.Map(list=string_from_object_4, f_x=indexOf_2)
string_from_object_6 = FromObject(map_2)
toNumber_2 = String.ToNumber(string_from_object_6)
code_block_8 = CodeBlock(a=toNumber_2) { a+1; }
code_block_9 = CodeBlock { 0; }
python_script = Python(IN[0]=code_block_7, IN[1]=code_block_8, IN[2]=code_block_9)
# ---------- python_script.python (19 lines) ----------
import clr
clr.AddReference('ProtoGeometry')
from Autodesk.DesignScript.Geometry import *
#The inputs to this node will be stored as a list in the IN variables.

stPoint = UnwrapElement(IN[0])
endPoint = UnwrapElement(IN[1])

elcounter = UnwrapElement(IN[2])

text = []

for i in range(0,len(stPoint)):
    elcounter = elcounter +1
    text.append("LINE	" + str(elcounter) +"		NO_RGB	LINE	" + str(stPoint[i]) + "	" + str(endPoint[i]) + "	0	0.000000	0	0	0	0	0	0	0	0.000000	0.000000	0.000000	0.000000	0.000000	0.000000	CM2_MESHTOOLS	NUM_SEGMENTS	1.00000	1.00000	1	NO")
    

#Assign your output to the OUT variable.
OUT = text
# ----------------------------------------
python_script_2 = Python(IN[0]=python_script)
# ---------- python_script_2.python (24 lines) ----------
import re
import operator
import clr
clr.AddReference('ProtoGeometry')
from Autodesk.DesignScript.Geometry import *
#The inputs to this node will be stored as a list in the IN variables.

hand = IN[0]

values=[]
   
for i in range(0,len(hand)):
	b = hand[i].rstrip()
	values.append(re.findall("^LINE	([0-9]+)",b))

"""
for line in hand:
    b = line.rstrip()
    if re.search("[0-9]+",b):
        values.append(re.findall("[0-9]+",b))

ciao = reduce(operator.add,values)
"""
OUT = values
# ----------------------------------------
code_block_10 = CodeBlock(a=python_script_2) { Flatten(a); }
string_from_array = FromArray(code_block_10)
python_script_3 = Python(IN[0]=string_from_array)
# ---------- python_script_3.python (14 lines) ----------
import clr
clr.AddReference('ProtoGeometry')
from Autodesk.DesignScript.Geometry import *
#The inputs to this node will be stored as a list in the IN variables.
text = IN[0]

text1= text.strip("{")

text2=text1.strip("}")

text3=text2.replace(","," ")

#Assign your output to the OUT variable.
OUT = text3
# ----------------------------------------
code_block_11 = CodeBlock { 0; }
code_block_12 = CodeBlock { "TWO_WAY"; }
py_area = Python(IN[0]=python_script_3, IN[1]=code_block_11, IN[2]=code_block_12)
# ---------- py_area.python (27 lines) ----------
LineList = IN[0]


OUT = str("\nAREA	1		NO_RGB	TWO_WAY	0.000000	1	1	" + LineList + "	0.000000\n")


import clr
clr.AddReference('ProtoGeometry')
from Autodesk.DesignScript.Geometry import *
#The inputs to this node will be stored as a list in the IN variables.

LineList = IN[0]

elcounter = IN[1]

AreaType = IN[2]

text = []

#for i in range(0,len(LineList)):
elcounter = elcounter +1

text.append("\nAREA	" + str(elcounter) +"		NO_RGB	"+str(AreaType)+"	0.000000	1	1	" + LineList + "	0.000000\n")
    

#Assign your output to the OUT variable.
OUT = text
# ----------------------------------------
code_block_13 = CodeBlock(Curve=chop) { Curve; }
flatten_2 = Flatten(code_block_13)
startPoint_2 = Curve.StartPoint(flatten_2)
string_from_object_7 = FromObject(startPoint_2)
code_block_14 = CodeBlock(Point=py_extract_points) { Point; }
string_from_object_8 = FromObject(code_block_14)
indexOf_3 = IndexOf(string_from_object_8)  # unwired: arg1
map_3 = List.Map(list=string_from_object_7, f_x=indexOf_3)
chop_2 = List.Chop(list=map_3, lengths=in_voids_edges)
string_from_object_9 = FromObject(chop_2)
toNumber_3 = String.ToNumber(string_from_object_9)
code_block_15 = CodeBlock(a=toNumber_3) { a+1; }
endPoint_2 = Curve.EndPoint(flatten_2)
string_from_object_10 = FromObject(endPoint_2)
string_from_object_11 = FromObject(code_block_14)
indexOf_4 = IndexOf(string_from_object_11)  # unwired: arg1
map_4 = List.Map(list=string_from_object_10, f_x=indexOf_4)
chop_3 = List.Chop(list=map_4, lengths=in_voids_edges)
string_from_object_12 = FromObject(chop_3)
toNumber_4 = String.ToNumber(string_from_object_12)
code_block_16 = CodeBlock(a=toNumber_4) { a+1; }
code_block_17 = CodeBlock { 8; }
python_script_4 = Python(IN[0]=code_block_15, IN[1]=code_block_16, IN[2]=code_block_17)
# ---------- python_script_4.python (20 lines) ----------
import clr
clr.AddReference('ProtoGeometry')
from Autodesk.DesignScript.Geometry import *
#The inputs to this node will be stored as a list in the IN variables.

stPoint = UnwrapElement(IN[0])
endPoint = UnwrapElement(IN[1])

elcounter = UnwrapElement(IN[2])

text = []

for i in range(0,len(stPoint)):
	for j in range(0,len(stPoint[i])):
	    elcounter = elcounter +1
	    text.append("LINE	" + str(elcounter) +"		NO_RGB	LINE	" + str(stPoint[i][j]) + "	" + str(endPoint[i][j]) + "	0	0.000000	0	0	0	0	0	0	0	0.000000	0.000000	0.000000	0.000000	0.000000	0.000000	CM2_MESHTOOLS	NUM_SEGMENTS	1.00000	1.00000	1	NO")
    

#Assign your output to the OUT variable.
OUT = text
# ----------------------------------------
python_script_5 = Python(IN[0]=python_script_4)  # same code as python_script_2
code_block_18 = CodeBlock(a=python_script_5) { Flatten(a); }
chop_4 = List.Chop(list=code_block_18, lengths=in_voids_edges)
python_script_6 = Python(IN[0]=chop_4)
# ---------- python_script_6.python (12 lines) ----------
import clr
clr.AddReference('ProtoGeometry')
from Autodesk.DesignScript.Geometry import *
#The inputs to this node will be stored as a list in the IN variables.
text = IN[0]
lst = []

for i in range(0,len(text)):
	lst.append(text[i][0] + str(" ")+text[i][1] + str(" ")+text[i][2] + str(" ")+text[i][3] + str(" "))

#Assign your output to the OUT variable.
OUT = lst
# ----------------------------------------
code_block_19 = CodeBlock { 10; }
code_block_20 = CodeBlock { "VOID "; }
py_area_2 = Python(IN[0]=python_script_6, IN[1]=code_block_19, IN[2]=code_block_20)
# ---------- py_area_2.python (20 lines) ----------
import clr
clr.AddReference('ProtoGeometry')
from Autodesk.DesignScript.Geometry import *
#The inputs to this node will be stored as a list in the IN variables.

LineList = IN[0]

elcounter = IN[1]

AreaType = IN[2]

text = []

for i in range(0,len(LineList)):
	elcounter = elcounter +1
	text.append("AREA	" + str(elcounter) +"		NO_RGB	"+str(AreaType)+"	0.000000	1	1	" + LineList[i] + "	0.000000\n")
    

#Assign your output to the OUT variable.
OUT = text
# ----------------------------------------
join = List.Join(py_area, py_area_2)
string_from_array_2 = FromArray(join)
python_script_7 = Python(IN[0]=string_from_array_2)
# ---------- python_script_7.python (14 lines) ----------
import clr
clr.AddReference('ProtoGeometry')
from Autodesk.DesignScript.Geometry import *
#The inputs to this node will be stored as a list in the IN variables.
text = IN[0]

text1= text.strip("{")

text2=text1.strip("}")

text3=text2.replace(",","")

#Assign your output to the OUT variable.
OUT = text3
# ----------------------------------------
code_block_21 = CodeBlock { ""; }
flatten_3 = Flatten(join)
python_script_8 = Python(IN[0]=flatten_3)
# ---------- python_script_8.python (21 lines) ----------
import re
import operator
import clr
clr.AddReference('ProtoGeometry')
from Autodesk.DesignScript.Geometry import *
#The inputs to this node will be stored as a list in the IN variables.

hand = IN[0]

values=[]
 
for line in hand:
	b = line.rstrip()
	values.append(re.findall("AREA	([0-9]+)",b))




OUT = values

    
# ----------------------------------------
flatten_4 = Flatten(python_script_8)
create_2 = List.Create(flatten_4)
python_script_9 = Python(IN[0]=create_2)  # same code as python_script_6
string_from_array_3 = FromArray(python_script_9)
python_script_10 = Python(IN[0]=string_from_array_3)  # same code as python_script_7
py_region = Python(IN[0]=code_block_21, IN[1]=python_script_10)
# ---------- py_region.python (10 lines) ----------
import clr
clr.AddReference('ProtoGeometry')
from Autodesk.DesignScript.Geometry import *
#The inputs to this node will be stored as a list in the IN variables.

Nodes = IN[0]
Areas = IN[1]


OUT = "REGION	1		NO_RGB	0	2D_MESH	" + str(Nodes) + "		" + str(Areas) + "	CM2_MESHTOOLS	YES	YES	YES	8	0.000000	0.500000	0.600000	QUAD8	NO	NO	NO	1.00000"
# ----------------------------------------
gsa_footers = Custom[GSA Footers]()
create_3 = List.Create(gsa_header, gsa_points, gsa_lines, python_script_7, py_region, gsa_footers)
writeToFile = CSV.WriteToFile(file_path, create_3)
group_curves = Custom[Group Curves](Curves=perimeterCurves)  # This node will take any input of flat list of curves and group them into sublists containing "joinable" curves that is continous curves. They might form closed curves or open curves. Use PolyCurve.ByJoinedCurves to convert output groups of curves into single PolyCurves
