# Dynamo graph GSA Floors01.dyn (Dynamo 1.2.0.2514)

file_path = Filename("..\..\..\..\Desktop\Test.txt")
gsa_header = Custom[GSA Header]()
select_model_element = DSModelElementSelection()  # 1 picked in the model
geometry = Element.Geometry(select_model_element)
code_block = CodeBlock(gt=geometry) { gt[0]; }
perimeterCurves = Surface.PerimeterCurves(code_block)
code_block_2 = CodeBlock(a=perimeterCurves) { Count(a); }
in_voids_number = CodeBlock { 4; }
in_voids_edges = CodeBlock { 4; }
code_block_3 = CodeBlock(a=in_voids_number, b=in_voids_edges) { a*b; }
code_block_4 = CodeBlock(a=code_block_2, b=code_block_3) { a-b; }
split = Custom[List.Split](list=perimeterCurves, amount=code_block_4)  # Splits a list at the desired length

# group: SLAB
simplify = Custom[CurveLoop.Simplify](curveLoop=split.list1)  # Attempts to simplify an open or a closed curve loop by connecting straight separate line segments into a single line.

code_block_5 = CodeBlock { 0.5; }
divideCurveByDistance = Geometry.Curves.DivideCurveByDistance(split.list1, code_block_5)
splitByPoints = Curve.SplitByPoints(curve=simplify, points=divideCurveByDistance)
flatten = Flatten(splitByPoints)

# group: VOIDS
chop = List.Chop(list=split.list2, lengths=in_voids_edges)

code_block_6 = CodeBlock { 0.5; }
divideCurveByDistance_2 = Geometry.Curves.DivideCurveByDistance(chop, code_block_6)
splitByPoints_2 = Curve.SplitByPoints(curve=chop, points=divideCurveByDistance_2)
create = List.Create(perimeterCurves, flatten, splitByPoints_2)
flatten_2 = Flatten(create)
py_extract_points = Python(IN[0]=flatten_2)
# ---------- py_extract_points.python (14 lines) ----------
import clr
clr.AddReference('ProtoGeometry')
from Autodesk.DesignScript.Geometry import *
#The inputs to this node will be stored as a list in the IN variables.
Curves = UnwrapElement(IN[0])

pts = []

for crv in Curves:
	pts.append(crv.StartPoint)
	pts.append(crv.EndPoint)

#Assign your output to the OUT variable.
OUT = pts
# ----------------------------------------
gsa_points = Custom[GSA Points](Points=py_extract_points)
flatten_3 = Flatten(splitByPoints_2)
group_curves = Custom[Group Curves](Curves=flatten_3)  # This node will take any input of flat list of curves and group them into sublists containing "joinable" curves that is continous curves. They might form closed curves or open curves. Use PolyCurve.ByJoinedCurves to convert output groups of curves into single PolyCurves
simplify_2 = Custom[CurveLoop.Simplify](curveLoop=group_curves)
create_2 = List.Create(flatten, simplify_2)
gsa_lines = Custom[GSA Lines](Point=py_extract_points, Curve=create_2)
code_block_7 = CodeBlock { "TWO_WAY"; }
code_block_8 = CodeBlock { 0; }
gsa_area = Custom[GSA Area](AreaType=code_block_7, Element_Counter=code_block_8, Boundary_Lines=flatten, Point_List=py_extract_points)
code_block_9 = CodeBlock { 20; }
code_block_10 = CodeBlock(a=flatten) { Count(a); }
gsa_void_area = Custom[GSA Void Area](Boundary_Lines=simplify_2, Point_List=py_extract_points, Area_Counter=code_block_9, Lines_Counter=code_block_10)
join = List.Join(gsa_area, gsa_void_area)
string_from_array = FromArray(join)
python_script = Python(IN[0]=string_from_array)
# ---------- python_script.python (14 lines) ----------
import clr
clr.AddReference('ProtoGeometry')
from Autodesk.DesignScript.Geometry import *
#The inputs to this node will be stored as a list in the IN variables.
text = IN[0]

text1= text.strip("{")

text2=text1.strip("}")

text3=text2.replace(",","")

#Assign your output to the OUT variable.
OUT = text3
# ----------------------------------------
code_block_11 = CodeBlock { ""; }
flatten_4 = Flatten(join)
python_script_2 = Python(IN[0]=flatten_4)
# ---------- python_script_2.python (21 lines) ----------
import re
import operator
import clr
clr.AddReference('ProtoGeometry')
from Autodesk.DesignScript.Geometry import *
#The inputs to this node will be stored as a list in the IN variables.

hand = IN[0]

values=[]
 
for line in hand:
	b = line.rstrip()
	values.append(re.findall("AREA	([0-9]+)",b))




OUT = values

    
# ----------------------------------------
flatten_5 = Flatten(python_script_2)
string_from_array_2 = FromArray(flatten_5)
python_script_3 = Python(IN[0]=string_from_array_2)
# ---------- python_script_3.python (14 lines) ----------
import clr
clr.AddReference('ProtoGeometry')
from Autodesk.DesignScript.Geometry import *
#The inputs to this node will be stored as a list in the IN variables.
text = IN[0]

text1= text.strip("{")

text2=text1.strip("}")

text3=text2.replace(","," ")

#Assign your output to the OUT variable.
OUT = text3
# ----------------------------------------
py_region = Python(IN[0]=code_block_11, IN[1]=python_script_3)
# ---------- py_region.python (10 lines) ----------
import clr
clr.AddReference('ProtoGeometry')
from Autodesk.DesignScript.Geometry import *
#The inputs to this node will be stored as a list in the IN variables.

Nodes = IN[0]
Areas = IN[1]


OUT = "REGION	1		NO_RGB	0	2D_MESH	" + str(Nodes) + "		" + str(Areas) + "	CM2_MESHTOOLS	YES	YES	YES	8	0.000000	0.500000	0.600000	QUAD8	NO	NO	NO	1.00000"
# ----------------------------------------
gsa_footers = Custom[GSA Footers]()
create_3 = List.Create(gsa_header, gsa_points, gsa_lines, python_script, py_region, gsa_footers)
writeToFile = CSV.WriteToFile(file_path, create_3)
