# Dynamo graph GSA Floors03.dyn (Dynamo 1.2.0.2514)

file_path = Filename("..\..\..\..\Desktop\Test.txt")
gsa_header = Custom[GSA Header]()
select_model_element = DSModelElementSelection()  # 1 picked in the model
geometry = Element.Geometry(select_model_element)
code_block = CodeBlock(gt=geometry) { gt[0]; }
perimeterCurves = Surface.PerimeterCurves(code_block)
code_block_2 = CodeBlock(a=perimeterCurves) { Count(a); }
in_voids_number = CodeBlock { 21; }
in_voids_edges = CodeBlock { 4; }
code_block_3 = CodeBlock(a=in_voids_number, b=in_voids_edges) { a*b; }
code_block_4 = CodeBlock(a=code_block_2, b=code_block_3) { a-b; }
split = Custom[List.Split](list=perimeterCurves, amount=code_block_4)  # Splits a list at the desired length

# group: SLAB
simplify = Custom[CurveLoop.Simplify](curveLoop=split.list1)  # Attempts to simplify an open or a closed curve loop by connecting straight separate line segments into a single line.

length = Curve.Length(split.list1)
code_block_5 = CodeBlock(a=length) { a/0.5; }
ceiling = Math.Ceiling(code_block_5)
pointsAtEqualSegmentLength = Curve.PointsAtEqualSegmentLength(curve=split.list1, divisions=ceiling)
splitByPoints = Curve.SplitByPoints(curve=simplify, points=pointsAtEqualSegmentLength)
flatten = Flatten(splitByPoints)

# group: VOIDS
chop = List.Chop(list=split.list2, lengths=in_voids_edges)

length_2 = Curve.Length(chop)
code_block_6 = CodeBlock(a=length_2) { a/0.5; }
ceiling_2 = Math.Ceiling(code_block_6)
pointsAtEqualSegmentLength_2 = Curve.PointsAtEqualSegmentLength(curve=chop, divisions=ceiling_2)
splitByPoints_2 = Curve.SplitByPoints(curve=chop, points=pointsAtEqualSegmentLength_2)
create = List.Create(perimeterCurves, flatten, splitByPoints_2)
flatten_2 = Flatten(create)
removeNulls = Lists.Manage.RemoveNulls(flatten_2)
py_extract_points = Python(IN[0]=removeNulls)
# ---------- py_extract_points.python (14 lines) ----------
import clr
clr.AddReference('ProtoGeometry')
from Autodesk.DesignScript.Geometry import *
#The inputs to this node will be stored as a list in the IN variables.
Curves = UnwrapElement(IN[0])

pts = []

for crv in Curves:
	pts.append(crv.StartPoint)
	pts.append(crv.EndPoint)

#Assign your output to the OUT variable.
OUT = pts
# ----------------------------------------
gsa_points = Custom[GSA Points](Points=py_extract_points)
flatten_3 = Flatten(splitByPoints_2)
group_curves = Custom[Group Curves](Curves=flatten_3)  # This node will take any input of flat list of curves and group them into sublists containing "joinable" curves that is continous curves. They might form closed curves or open curves. Use PolyCurve.ByJoinedCurves to convert output groups of curves into single PolyCurves
simplify_2 = Custom[CurveLoop.Simplify](curveLoop=group_curves)
create_2 = List.Create(flatten, simplify_2)
gsa_lines = Custom[GSA Lines](Point=py_extract_points, Curve=create_2)
code_block_7 = CodeBlock { "TWO_WAY"; }
code_block_8 = CodeBlock { 0; }
gsa_area = Custom[GSA Area](AreaType=code_block_7, Element_Counter=code_block_8, Boundary_Lines=flatten, Point_List=py_extract_points)
code_block_9 = CodeBlock { 10; }
code_block_10 = CodeBlock(a=flatten) { Count(a); }
gsa_void_area = Custom[GSA Void Area](Boundary_Lines=simplify_2, Point_List=py_extract_points, Area_Counter=code_block_9, Lines_Counter=code_block_10)
join = List.Join(gsa_area, gsa_void_area)
string_from_array = FromArray(join)
py_string_replace = Python(IN[0]=string_from_array)
# ---------- py_string_replace.python (14 lines) ----------
import clr
clr.AddReference('ProtoGeometry')
from Autodesk.DesignScript.Geometry import *
#The inputs to this node will be stored as a list in the IN variables.
text = IN[0]

text1= text.strip("{")

text2=text1.strip("}")

text3=text2.replace(",","")

#Assign your output to the OUT variable.
OUT = text3
# ----------------------------------------
code_block_11 = CodeBlock { ""; }
flatten_4 = Flatten(join)
python_script = Python(IN[0]=flatten_4)
# ---------- python_script.python (21 lines) ----------
import re
import operator
import clr
clr.AddReference('ProtoGeometry')
from Autodesk.DesignScript.Geometry import *
#The inputs to this node will be stored as a list in the IN variables.

hand = IN[0]

values=[]
 
for line in hand:
	b = line.rstrip()
	values.append(re.findall("AREA	([0-9]+)",b))




OUT = values

    
# ----------------------------------------
flatten_5 = Flatten(python_script)
string_from_array_2 = FromArray(flatten_5)
python_script_2 = Python(IN[0]=string_from_array_2)
# ---------- python_script_2.python (14 lines) ----------
import clr
clr.AddReference('ProtoGeometry')
from Autodesk.DesignScript.Geometry import *
#The inputs to this node will be stored as a list in the IN variables.
text = IN[0]

text1= text.strip("{")

text2=text1.strip("}")

text3=text2.replace(","," ")

#Assign your output to the OUT variable.
OUT = text3
# ----------------------------------------
py_region = Python(IN[0]=code_block_11, IN[1]=python_script_2)
# ---------- py_region.python (10 lines) ----------
import clr
clr.AddReference('ProtoGeometry')
from Autodesk.DesignScript.Geometry import *
#The inputs to this node will be stored as a list in the IN variables.

Nodes = IN[0]
Areas = IN[1]


OUT = "REGION	1		NO_RGB	0	2D_MESH	" + str(Nodes) + "		" + str(Areas) + "	CM2_MESHTOOLS	YES	YES	YES	8	0.000000	0.500000	0.600000	QUAD8	NO	NO	NO	1.00000"
# ----------------------------------------
code_block_12 = CodeBlock { "570.610"; }
gsa_grid_plane = Custom[GSA Grid Plane](Elevation=code_block_12)
select_model_elements = DSModelElementsSelection()  # 9 picked in the model
boundaries = Custom[Room.Boundaries](Room=select_model_elements)  # This node returns all Room bounding curves and elements that generated them (walls, separation lines etc).
startPoint = Curve.StartPoint(boundaries.Curve)
deconstructPoint = Geometry.Points.DeconstructPoint(startPoint)
string_from_object = FromObject(deconstructPoint.out0)
string_from_object_2 = FromObject(deconstructPoint.out1)
python_script_3 = Python(IN[0]=string_from_object, IN[1]=string_from_object_2)
# ---------- python_script_3.python (16 lines) ----------
import clr
clr.AddReference('ProtoGeometry')
from Autodesk.DesignScript.Geometry import *
#The inputs to this node will be stored as a list in the IN variables.
PtX = IN[0]

PtY = IN[1]

let = []

for i in range(0,len(PtX)):
	for j in range(0,len(PtX[i])):
		let.append("(" + str(PtX[i][j]) + ";" + str(PtY[i][j]) + ")" )

#Assign your output to the OUT variable.
OUT = let
# ----------------------------------------
count = Count(boundaries.Curve@@L2)
chop_2 = List.Chop(list=python_script_3, lengths=count)
string_from_array_3 = FromArray(chop_2)
code_block_13 = CodeBlock { "},{"; }
split_2 = String.Split(string_from_array_3, code_block_13)
code_block_14 = CodeBlock { 12; }
python_script_4 = Python(IN[0]=split_2, IN[1]=code_block_14)
# ---------- python_script_4.python (28 lines) ----------
import clr
clr.AddReference('ProtoGeometry')
from Autodesk.DesignScript.Geometry import *
#The inputs to this node will be stored as a list in the IN variables.
text = IN[0]
elcounter = IN[1]

lt = []
let = []

GSAPol = []

for tx in text:
	text1= tx.strip("{")
	text2=text1.strip("}")
	lt.append(text2.replace(","," "))

for ltt in lt:
	let.append(ltt.replace(";",";"))

for i in range(0,len(let)):
	elcounter = elcounter +1
	GSAPol.append("POLYLINE_2D	" + str(elcounter) + '	2D Polyline ' + str(elcounter) +'	"' + let[i] +'"\n')



#Assign your output to the OUT variable.
OUT = GSAPol
# ----------------------------------------
string_from_array_4 = FromArray(python_script_4)
py_string_replace_2 = Python(IN[0]=string_from_array_4)
# ---------- py_string_replace_2.python (16 lines) ----------
import clr
clr.AddReference('ProtoGeometry')
from Autodesk.DesignScript.Geometry import *
#The inputs to this node will be stored as a list in the IN variables.
text = IN[0]

text1= text.strip("{")

text2=text1.strip("}")

text3=text2.replace(",","")

text4=text3.replace(";",",")

#Assign your output to the OUT variable.
OUT = text4
# ----------------------------------------
flatten_6 = Flatten(python_script_4)
python_script_5 = Python(IN[0]=flatten_6)
# ---------- python_script_5.python (21 lines) ----------
import re
import operator
import clr
clr.AddReference('ProtoGeometry')
from Autodesk.DesignScript.Geometry import *
#The inputs to this node will be stored as a list in the IN variables.

hand = IN[0]

values=[]
 
for line in hand:
	b = line.rstrip()
	values.append(re.findall("POLYLINE_2D	([0-9]+)",b))




OUT = values

    
# ----------------------------------------
flatten_7 = Flatten(python_script_5)
python_script_6 = Python(IN[0]=flatten_7)
# ---------- python_script_6.python (17 lines) ----------
import clr
clr.AddReference('ProtoGeometry')
from Autodesk.DesignScript.Geometry import *
#The inputs to this node will be stored as a list in the IN variables.

el = IN[0]
elcounter = 0
Load = []

for i in range(0,len(el)):
	elcounter = elcounter +1
	Load.append("LOAD_GRID_AREA	" + str(elcounter) + '	1	POLYREF	' + str(el[i]) + "	1	GLOBAL	NO	Z	-1" +'	\n')



#Assign your output to the OUT variable.
OUT = Load
# ----------------------------------------
string_from_array_5 = FromArray(python_script_6)
python_script_7 = Python(IN[0]=string_from_array_5)  # same code as py_string_replace
gsa_footers = Custom[GSA Footers]()
create_3 = List.Create(gsa_header, gsa_points, gsa_lines, py_string_replace, py_region, gsa_grid_plane, py_string_replace_2, python_script_7, gsa_footers)
writeToFile = CSV.WriteToFile(file_path, create_3)
class_ = Custom[Object.Class](obj=select_model_elements)  # Gets the input object's class name. Can process lists.
