# Dynamo graph gsa dynamo revit test 01.dyn (Dynamo 0.7.5.3293)

string = StringInput("C:\Users\Thorsten\Desktop\gsa dynamo revit test\Steel_Design_Complex Structure Nodes Data clean.csv")
fromPath = FileObject(string)  # "File.FromPath"
readFromFile = CSV.ReadFromFile(fromPath)
code_block = CodeBlock { 1; }
flatten = List.Flatten(readFromFile, code_block)
# note: exchange aganist something more stable than counting strings !!
code_block_2 = CodeBlock { 0; }
code_block_3 = CodeBlock { 4; }
substring = String.Substring(flatten, code_block_2, code_block_3)
trimTrailingWhitespace = String.TrimTrailingWhitespace(substring)
length = String.Length(trimTrailingWhitespace)
length_2 = String.Length(flatten)
sub = length_2 - length
substring_2 = String.Substring(flatten, length, sub)
string_2 = StringInput(" ")
split = String.Split(substring_2, string_2)
code_block_4 = CodeBlock { 1; }
flatten_2 = List.Flatten(split, code_block_4)
code_block_5 = CodeBlock { 0; }
count = List.Count(flatten_2)
code_block_6 = CodeBlock { 1; }
sub_2 = count - code_block_6
code_block_7 = CodeBlock { 3; }
number_range = NumberRange(code_block_5, sub_2, code_block_7, lacing=Longest)
getItemAtIndex = List.GetItemAtIndex(flatten_2, number_range)
toNumber = String.ToNumber(getItemAtIndex)
number_range_2 = NumberRange(code_block_6, count, code_block_7, lacing=Longest)
getItemAtIndex_2 = List.GetItemAtIndex(flatten_2, number_range_2)
toNumber_2 = String.ToNumber(getItemAtIndex_2)
code_block_8 = CodeBlock { 2; }
number_range_3 = NumberRange(code_block_8, count, code_block_7, lacing=Longest)
getItemAtIndex_3 = List.GetItemAtIndex(flatten_2, number_range_3)
toNumber_3 = String.ToNumber(getItemAtIndex_3)
byCoordinates = Point.ByCoordinates(toNumber, toNumber_2, toNumber_3)
getItemAtIndex_4 = List.GetItemAtIndex(byCoordinates)
getItemAtIndex_5 = List.GetItemAtIndex(byCoordinates)
byStartPointEndPoint = Line.ByStartPointEndPoint(getItemAtIndex_4, getItemAtIndex_5)
string_3 = StringInput(" ")
split_2 = String.Split(flatten, string_3)
string_4 = StringInput("C:\Users\Thorsten\Desktop\gsa dynamo revit test\Steel_Design_Complex Structure Member Data clean.csv")
fromPath_2 = FileObject(string_4)  # "File.FromPath"
readFromFile_2 = CSV.ReadFromFile(fromPath_2)
code_block_9 = CodeBlock { 1; }
flatten_3 = List.Flatten(readFromFile_2, code_block_9)
string_5 = StringInput(" ")
split_3 = String.Split(flatten_3, string_5)
code_block_10 = CodeBlock { 1; }
flatten_4 = List.Flatten(split_3, code_block_10)
code_block_11 = CodeBlock { 0; }
count_2 = List.Count(flatten_4)
code_block_12 = CodeBlock { 1; }
sub_3 = count_2 - code_block_12
code_block_13 = CodeBlock { 3; }
number_range_4 = NumberRange(code_block_11, sub_3, code_block_13, lacing=Longest)
getItemAtIndex_6 = List.GetItemAtIndex(flatten_4, number_range_4)
length_3 = String.Length(getItemAtIndex_6)
length_4 = String.Length(flatten_3)
sub_4 = length_4 - length_3
substring_3 = String.Substring(flatten_3, length_3, sub_4)
string_6 = StringInput(" ")
split_4 = String.Split(substring_3, string_6)
code_block_14 = CodeBlock { 1; }
flatten_5 = List.Flatten(split_4, code_block_14)
code_block_15 = CodeBlock { 1; }
count_3 = List.Count(flatten_5)
code_block_16 = CodeBlock { 1; }
sub_5 = count_3 - code_block_16
code_block_17 = CodeBlock { 2; }
number_range_5 = NumberRange(code_block_15, sub_5, code_block_17, lacing=Longest)
getItemAtIndex_7 = List.GetItemAtIndex(flatten_5, number_range_5)
code_block_18 = CodeBlock { 1; }
flatten_6 = List.Flatten(split_4, code_block_18)
code_block_19 = CodeBlock { 0; }
count_4 = List.Count(flatten_6)
code_block_20 = CodeBlock { 1; }
sub_6 = count_4 - code_block_20
code_block_21 = CodeBlock { 2; }
number_range_6 = NumberRange(code_block_19, sub_6, code_block_21, lacing=Longest)
getItemAtIndex_8 = List.GetItemAtIndex(flatten_6, number_range_6)
code_block_22 = CodeBlock { 3; }
getItemAtIndex_9 = List.GetItemAtIndex(getItemAtIndex_8, code_block_22)
toNumber_4 = String.ToNumber(getItemAtIndex_9)
trimTrailingWhitespace_2 = String.TrimTrailingWhitespace(substring)
toNumber_5 = String.ToNumber(trimTrailingWhitespace_2)
if_equal_return_index = Custom[If Equal Return Index](listA=toNumber_4, listB=toNumber_5)  # If element in list A is equal to an element in list B then return index from list B.
code_block_23 = CodeBlock { 0; }
code_block_24 = CodeBlock { 15; }
code_block_25 = CodeBlock { 1; }
number_range_7 = NumberRange(code_block_23, code_block_24, code_block_25, lacing=Longest)
shuffle = List.Shuffle(number_range_7)
number = DoubleInput(3)
number_2 = DoubleInput(9)
number_3 = DoubleInput(12)
create = List.Create(number, number_2, number_3)
if_equal_return_index_2 = Custom[If Equal Return Index](listA=create, listB=shuffle)
getItemAtIndex_10 = List.GetItemAtIndex(shuffle, if_equal_return_index_2)
