# Dynamo graph gsa dynamo revit test 02.dyn (Dynamo 0.7.5.3282)

string = StringInput("Y:\Miscellaneous\Dynamo\Scripts\examples\GSA results to revit\Steel_Design_Complex Structure Nodes Data clean.csv")
string_2 = StringInput("Y:\Miscellaneous\Dynamo\Scripts\examples\GSA results to revit\Steel_Design_Complex Structure Member Data clean.csv")
fromPath = FileObject()  # "File.FromPath"
readFromFile = CSV.ReadFromFile(fromPath)
code_block = CodeBlock { 1; }
flatten = List.Flatten(readFromFile, code_block)
string_3 = StringInput(" ")
split = String.Split(flatten, string_3)
# note: exchange aganist something more stable than counting strings !!
code_block_2 = CodeBlock { 0; }
code_block_3 = CodeBlock { 4; }
substring = String.Substring(flatten, code_block_2, code_block_3)
trimTrailingWhitespace = String.TrimTrailingWhitespace(substring)
length = String.Length(trimTrailingWhitespace)
length_2 = String.Length(flatten)
sub = length_2 - length
substring_2 = String.Substring(flatten, length, sub)
string_4 = StringInput(" ")
split_2 = String.Split(substring_2, string_4)
code_block_4 = CodeBlock { 1; }
flatten_2 = List.Flatten(split_2, code_block_4)
code_block_5 = CodeBlock { 0; }
count = List.Count(flatten_2)
code_block_6 = CodeBlock { 1; }
sub_2 = count - code_block_6
code_block_7 = CodeBlock { 3; }
number_range = NumberRange(code_block_5, sub_2, code_block_7, lacing=Longest)
getItemAtIndex = List.GetItemAtIndex(flatten_2, number_range)
toNumber = String.ToNumber(getItemAtIndex)
number_range_2 = NumberRange(code_block_6, count, code_block_7, lacing=Longest)
getItemAtIndex_2 = List.GetItemAtIndex(flatten_2, number_range_2)
toNumber_2 = String.ToNumber(getItemAtIndex_2)
code_block_8 = CodeBlock { 2; }
number_range_3 = NumberRange(code_block_8, count, code_block_7, lacing=Longest)
getItemAtIndex_3 = List.GetItemAtIndex(flatten_2, number_range_3)
toNumber_3 = String.ToNumber(getItemAtIndex_3)
byCoordinates = Point.ByCoordinates(toNumber, toNumber_2, toNumber_3)
fromPath_2 = FileObject()  # "File.FromPath"
readFromFile_2 = CSV.ReadFromFile(fromPath_2)
code_block_9 = CodeBlock { 1; }
flatten_3 = List.Flatten(readFromFile_2, code_block_9)
string_5 = StringInput(" ")
split_3 = String.Split(flatten_3, string_5)
code_block_10 = CodeBlock { 1; }
flatten_4 = List.Flatten(split_3, code_block_10)
code_block_11 = CodeBlock { 0; }
count_2 = List.Count(flatten_4)
code_block_12 = CodeBlock { 1; }
sub_3 = count_2 - code_block_12
code_block_13 = CodeBlock { 3; }
number_range_4 = NumberRange(code_block_11, sub_3, code_block_13, lacing=Longest)
getItemAtIndex_4 = List.GetItemAtIndex(flatten_4, number_range_4)
length_3 = String.Length(getItemAtIndex_4)
length_4 = String.Length(flatten_3)
sub_4 = length_4 - length_3
substring_3 = String.Substring(flatten_3, length_3, sub_4)
string_6 = StringInput(" ")
split_4 = String.Split(substring_3, string_6)
code_block_14 = CodeBlock { 1; }
flatten_5 = List.Flatten(split_4, code_block_14)
code_block_15 = CodeBlock { 0; }
count_3 = List.Count(flatten_5)
code_block_16 = CodeBlock { 1; }
sub_5 = count_3 - code_block_16
code_block_17 = CodeBlock { 2; }
number_range_5 = NumberRange(code_block_15, sub_5, code_block_17, lacing=Longest)
getItemAtIndex_5 = List.GetItemAtIndex(flatten_5, number_range_5)
toNumber_4 = String.ToNumber(getItemAtIndex_5)
create = List.Create(toNumber_4)
code_block_18 = CodeBlock { 1; }
flatten_6 = List.Flatten(create, code_block_18)
trimTrailingWhitespace_2 = String.TrimTrailingWhitespace(substring)
toNumber_5 = String.ToNumber(trimTrailingWhitespace_2)
create_2 = List.Create(toNumber_5)
code_block_19 = CodeBlock { 1; }
# note: Dayle's new bit
flatten_7 = List.Flatten(create_2, code_block_19)
if_equal_return_index = Custom[If Equal Return Index](listA=flatten_6, listB=flatten_7)  # If element in list A is equal to an element in list B then return index from list B.
getItemAtIndex_6 = List.GetItemAtIndex(byCoordinates, if_equal_return_index)
code_block_20 = CodeBlock { 1; }
flatten_8 = List.Flatten(split_4, code_block_20)
code_block_21 = CodeBlock { 1; }
count_4 = List.Count(flatten_8)
code_block_22 = CodeBlock { 1; }
sub_6 = count_4 - code_block_22
code_block_23 = CodeBlock { 2; }
number_range_6 = NumberRange(code_block_21, sub_6, code_block_23, lacing=Longest)
getItemAtIndex_7 = List.GetItemAtIndex(flatten_8, number_range_6)
toNumber_6 = String.ToNumber(getItemAtIndex_7)
create_3 = List.Create(toNumber_6)
code_block_24 = CodeBlock { 1; }
flatten_9 = List.Flatten(create_3, code_block_24)
if_equal_return_index_2 = Custom[If Equal Return Index](listA=flatten_9, listB=flatten_7)
getItemAtIndex_8 = List.GetItemAtIndex(byCoordinates, if_equal_return_index_2)
byStartPointEndPoint = Line.ByStartPointEndPoint(getItemAtIndex_6, getItemAtIndex_8)
levels = Levels("Level 1")
structural_framing_types = StructuralFramingTypes("CHS33.7x3")
beamByCurve = StructuralFraming.BeamByCurve(byStartPointEndPoint, levels, structural_framing_types)
code_block_25 = CodeBlock { 122; }
byARGB = Color.ByARGB(code_block_25)
overrideColorInView = Element.OverrideColorInView(beamByCurve, byARGB)
code_block_26 = CodeBlock { 125; }
string_7 = StringInput("Y:\Miscellaneous\Dynamo\Scripts\examples\GSA results to revit\Steel_Design_Complex Stress table clean reduced C3 von Mises.csv")
fromPath_3 = FileObject(string_7)  # "File.FromPath"
readFromFile_3 = CSV.ReadFromFile(fromPath_3)
code_block_27 = CodeBlock { 1; }
flatten_10 = List.Flatten(readFromFile_3, code_block_27)
