# Dynamo graph Gsa Frame.dyn (Dynamo 1.2.0.2514)

select_model_elements = DSModelElementsSelection()  # 39 picked in the model
watch = Watch(select_model_elements)
gsa_header = Custom[GSA Header]()
geometry = Element.Geometry(select_model_elements)
flatten = Flatten(geometry)
class_ = Custom[Object.Class](obj=flatten)  # Gets the input object's class name. Can process lists.
code_block = CodeBlock { "Point"; }
contains = String.Contains(str=class_.class_str, searchFor=code_block)
filterByBoolMask = List.FilterByBoolMask(list=flatten, mask=contains)
gsa_points = Custom[GSA Points](Points=filterByBoolMask.in)
flatten_2 = Flatten(filterByBoolMask.in)
curves = Element.Curves(select_model_elements)
isEmpty = List.IsEmpty(curves, lacing=Longest)
filterByBoolMask_2 = List.FilterByBoolMask(list=curves, mask=isEmpty)
byJoinedCurves = PolyCurve.ByJoinedCurves(filterByBoolMask_2.out)
create = List.Create(byJoinedCurves)
flatten_3 = Flatten(create)
startPoint = Curve.StartPoint(flatten_3)
endPoint = Curve.EndPoint(flatten_3)
gsa_beam_elements = Custom[GSA Beam Elements](GSA_Point_List=flatten_2, Start_Points=startPoint, End_Points=endPoint)
gsa_footers = Custom[GSA Footers]()
concat = String.Concat(gsa_header, gsa_points, gsa_beam_elements, gsa_footers)
writeText = File.WriteText(arg1=concat)  # unwired: arg0
file_path = Filename("..\..\..\..\Desktop\Test.txt")
file_path_2 = Filename("..\..\..\..\Desktop\Test.txt")
gsa_header_2 = Custom[GSA Header]()
select_model_element = DSModelElementSelection()  # 1 picked in the model
geometry_2 = Element.Geometry(select_model_element)
startPoint_2 = Curve.StartPoint(geometry_2)
endPoint_2 = Curve.EndPoint(geometry_2)
create_2 = List.Create(startPoint_2, endPoint_2)
flatten_4 = Flatten(create_2)
byBestFitThroughPoints = Arc.ByBestFitThroughPoints(flatten_4)
intersect = Geometry.Intersect(geometry=byBestFitThroughPoints, other=flatten_2)
flatten_5 = Flatten(intersect)
gsa_points_2 = Custom[GSA Points](Points=flatten_5)
splitByPoints = Curve.SplitByPoints(curve=byBestFitThroughPoints, points=flatten_5)
startPoint_3 = Curve.StartPoint(splitByPoints)
endPoint_3 = Curve.EndPoint(splitByPoints)
gsa_beam_elements_2 = Custom[GSA Beam Elements](GSA_Point_List=flatten_5, Start_Points=startPoint_3, End_Points=endPoint_3)
gsa_footers_2 = Custom[GSA Footers]()
concat_2 = String.Concat(gsa_header_2, gsa_points_2, gsa_beam_elements_2, gsa_footers_2)
writeText_2 = File.WriteText(file_path_2, concat_2)
select_model_elements_2 = DSModelElementsSelection()  # 9 picked in the model
geometry_3 = Element.Geometry(select_model_elements_2)
