# Dynamo graph Gsa Frame01.dyn (Dynamo 1.2.0.2514)

select_model_elements = DSModelElementsSelection()  # 591 picked in the model
watch = Watch(select_model_elements)
file_path = Filename("..\..\..\..\Desktop\Test.txt")
gsa_header = Custom[GSA Header]()
geometry = Element.Geometry(select_model_elements)
flatten = Flatten(geometry)
class_ = Custom[Object.Class](obj=flatten)  # Gets the input object's class name. Can process lists.
code_block = CodeBlock { "Point"; }
contains = String.Contains(str=class_.class_str, searchFor=code_block)
filterByBoolMask = List.FilterByBoolMask(list=flatten, mask=contains)
class_2 = Custom[Object.Class](obj=flatten)
code_block_2 = CodeBlock { "Arc"; }
contains_2 = String.Contains(str=class_2.class_str, searchFor=code_block_2)
filterByBoolMask_2 = List.FilterByBoolMask(list=flatten, mask=contains_2)
flatten_2 = Flatten(filterByBoolMask_2.in)
startPoint = Curve.StartPoint(flatten_2)
endPoint = Curve.EndPoint(flatten_2)
create = List.Create(startPoint, endPoint)
flatten_3 = Flatten(create)
byBestFitThroughPoints = Arc.ByBestFitThroughPoints(flatten_3)
flatten_4 = Flatten(filterByBoolMask.in)
intersect = Geometry.Intersect(geometry=byBestFitThroughPoints, other=flatten_4)
flatten_5 = Flatten(intersect)
create_2 = List.Create(filterByBoolMask.in, flatten_5)
flatten_6 = Flatten(create_2)
gsa_points = Custom[GSA Points](Points=flatten_6)
curves = Element.Curves(select_model_elements)
isEmpty = List.IsEmpty(curves, lacing=Longest)
filterByBoolMask_3 = List.FilterByBoolMask(list=curves, mask=isEmpty)
byJoinedCurves = PolyCurve.ByJoinedCurves(filterByBoolMask_3.out)
splitByPoints = Curve.SplitByPoints(curve=byBestFitThroughPoints, points=flatten_5)
create_3 = List.Create(byJoinedCurves, splitByPoints)
flatten_7 = Flatten(create_3)
startPoint_2 = Curve.StartPoint(flatten_7)
endPoint_2 = Curve.EndPoint(flatten_7)
gsa_beam_elements = Custom[GSA Beam Elements](GSA_Point_List=flatten_6, Start_Points=startPoint_2, End_Points=endPoint_2)
gsa_footers = Custom[GSA Footers]()
concat = String.Concat(gsa_header, gsa_points, gsa_beam_elements, gsa_footers)
writeText = File.WriteText(file_path, concat)
setDifference = SetDifference(filterByBoolMask_3.out)  # unwired: arg1
