# Dynamo graph Gsa Frame02.dyn (Dynamo 1.2.0.2514)

select_model_elements = DSModelElementsSelection()  # 591 picked in the model
watch = Watch(select_model_elements)
file_path = Filename("..\..\..\..\Desktop\Test.txt")
gsa_header = Custom[GSA Header]()
geometry = Element.Geometry(select_model_elements)
flatten = Flatten(geometry)
class_ = Custom[Object.Class](obj=flatten)  # Gets the input object's class name. Can process lists.
code_block = CodeBlock { "Point"; }
contains = String.Contains(str=class_.class_str, searchFor=code_block)
filterByBoolMask = List.FilterByBoolMask(list=flatten, mask=contains)
create = List.Create(filterByBoolMask.in)
flatten_2 = Flatten(create)
gsa_points = Custom[GSA Points](Points=flatten_2)
curves = Element.Curves(select_model_elements)
isEmpty = List.IsEmpty(curves, lacing=Longest)
filterByBoolMask_2 = List.FilterByBoolMask(list=curves, mask=isEmpty)
byJoinedCurves = PolyCurve.ByJoinedCurves(filterByBoolMask_2.out)
class_2 = Custom[Object.Class](obj=flatten)
code_block_2 = CodeBlock { "Arc"; }
contains_2 = String.Contains(str=class_2.class_str, searchFor=code_block_2)
filterByBoolMask_3 = List.FilterByBoolMask(list=flatten, mask=contains_2)
flatten_3 = Flatten(filterByBoolMask_3.in)
splitByPoints = Curve.SplitByPoints(curve=flatten_3, points=filterByBoolMask.in, lacing=Longest)
create_2 = List.Create(byJoinedCurves, splitByPoints)
flatten_4 = Flatten(create_2)
startPoint = Curve.StartPoint(flatten_4)
endPoint = Curve.EndPoint(flatten_4)
gsa_beam_elements = Custom[GSA Beam Elements](GSA_Point_List=flatten_2, Start_Points=startPoint, End_Points=endPoint)
gsa_footers = Custom[GSA Footers]()
concat = String.Concat(gsa_header, gsa_points, gsa_beam_elements, gsa_footers)
writeText = File.WriteText(file_path, concat)
flatten_5 = Flatten(filterByBoolMask.in)
flatten_6 = Flatten()  # unwired: arg0
setDifference = SetDifference(filterByBoolMask_2.out)  # unwired: arg1
code_block_3 = CodeBlock { 0.1; }
doesIntersect = Geometry.DoesIntersect(geometry=flatten_3, other=byJoinedCurves, lacing=Longest)
filterByBoolMask_4 = List.FilterByBoolMask(list=byJoinedCurves, mask=doesIntersect)
select_model_element = DSModelElementSelection()  # 1 picked in the model
geometry_2 = Element.Geometry(select_model_element)
