# Dynamo graph Gsa Surfaces.dyn (Dynamo 1.2.0.2514)

select_model_elements = DSModelElementsSelection()
watch = Watch(select_model_elements)
file_path = Filename("..\..\..\..\Desktop\Test.txt")
gsa_header = Custom[GSA Header]()
geometry = Element.Geometry(select_model_elements)
flatten = Flatten(geometry)
class_ = Custom[Object.Class](obj=flatten)  # Gets the input object's class name. Can process lists.
code_block = CodeBlock { "Point"; }
contains = String.Contains(str=class_.class_str, searchFor=code_block)
filterByBoolMask = List.FilterByBoolMask(list=flatten, mask=contains)
flatten_2 = Flatten(filterByBoolMask.in)
code_block_2 = CodeBlock { 0; }
pruneDuplicates = Point.PruneDuplicates(points=flatten_2, tolerance=code_block_2)
gsa_points = Custom[GSA Points](Points=pruneDuplicates)
class_2 = Custom[Object.Class](obj=flatten)
code_block_3 = CodeBlock { "Line"; }
contains_2 = String.Contains(str=class_2.class_str, searchFor=code_block_3)
filterByBoolMask_2 = List.FilterByBoolMask(list=flatten, mask=contains_2)
startPoint = Curve.StartPoint(filterByBoolMask_2.in)
endPoint = Curve.EndPoint(filterByBoolMask_2.in)
gsa_beam_elements = Custom[GSA Beam Elements](GSA_Point_List=pruneDuplicates, Start_Points=startPoint, End_Points=endPoint)
gsa_footers = Custom[GSA Footers]()
concat = String.Concat(gsa_header, gsa_points, gsa_beam_elements, gsa_footers)
writeText = File.WriteText(file_path, concat)
