# Dynamo graph Gsa Surfaces01.dyn (Dynamo 1.2.0.2514)

select_model_elements = DSModelElementsSelection()  # 16 picked in the model
watch = Watch(select_model_elements)
file_path = Filename("..\..\..\..\Desktop\Test.txt")
gsa_header = Custom[GSA Header]()
geometry = Element.Geometry(select_model_elements)
flatten = Flatten(geometry)
class_ = Custom[Object.Class](obj=flatten)  # Gets the input object's class name. Can process lists.
code_block = CodeBlock { "Surface"; }
contains = String.Contains(str=class_.class_str, searchFor=code_block)
filterByBoolMask = List.FilterByBoolMask(list=flatten, mask=contains)
code_block_2 = CodeBlock { 5; }
area = Solid.Area(filterByBoolMask.in)
code_block_3 = CodeBlock { 3; }
div = area / code_block_3
panelQuad = Geometry.Panel.PanelQuad(filterByBoolMask.in, code_block_2, div)
deconstructSurface = Geometry.Surfaces.DeconstructSurface(panelQuad)
code_block_4 = CodeBlock { 1; }
flatten_2 = List.Flatten(list=deconstructSurface.out1, amt=code_block_4)
flatten_3 = Flatten(flatten_2)
code_block_5 = CodeBlock { 0; }
pruneDuplicates = Point.PruneDuplicates(points=flatten_3, tolerance=code_block_5)
gsa_points = Custom[GSA Points](Points=pruneDuplicates)
gsa_walls = Custom[GSA Walls](Point_List=pruneDuplicates, Surface_Points=flatten_2)
gsa_footers = Custom[GSA Footers]()
concat = String.Concat(gsa_header, gsa_points, gsa_walls, gsa_footers)
writeText = File.WriteText(file_path, concat)
code_block_6 = CodeBlock { 1; }
getItemAtIndex = List.GetItemAtIndex(index=code_block_6)  # unwired: list
map = List.Map(list=deconstructSurface.out1, f_x=getItemAtIndex)
byPointsFaceIndices = Mesh.ByPointsFaceIndices()  # unwired: arg0, arg1
select_model_elements_2 = DSModelElementsSelection()  # 1 picked in the model
geometry_2 = Element.Geometry(select_model_elements_2)
flatten_4 = Flatten(geometry_2)
restOfItems = List.RestOfItems(flatten_4)
divideCurve = Geometry.Curves.DivideCurve(restOfItems)  # unwired: arg1
