# Dynamo graph Gsa Surfaces03.dyn (Dynamo 1.2.0.2514)

select_model_elements = DSModelElementsSelection()  # 25 picked in the model
watch = Watch(select_model_elements)
file_path = Filename("..\..\..\..\Desktop\Test.txt")
gsa_header = Custom[GSA Header]()
code_block = CodeBlock { 40; }
code_block_2 = CodeBlock { 30; }
panelQuad = Geometry.Panel.PanelQuad(arg1=code_block, arg2=code_block_2)  # unwired: arg0
deconstructSurface = Geometry.Surfaces.DeconstructSurface(panelQuad)
code_block_3 = CodeBlock { 0; }
flatten = List.Flatten(list=deconstructSurface.out1, amt=code_block_3)
flatten_2 = Flatten(flatten)
code_block_4 = CodeBlock { 0; }
pruneDuplicates = Point.PruneDuplicates(points=flatten_2, tolerance=code_block_4)
gsa_points = Custom[GSA Points](Points=pruneDuplicates)
gsa_walls = Custom[GSA Walls](Point_List=pruneDuplicates, Surface_Points=flatten)
gsa_footers = Custom[GSA Footers]()
concat = String.Concat(gsa_header, gsa_points, gsa_walls, gsa_footers)
writeText = File.WriteText(file_path, concat)
file_path_2 = Filename("..\..\..\..\Desktop\presentation\roof.sat")
fromPath = FileObject(file_path_2)  # "File.FromPath"
importFromSAT = Geometry.ImportFromSAT(fromPath)
geometry = Element.Geometry(importFromSAT)
flatten_3 = Flatten(geometry)
python_script = Python(IN[0]=importFromSAT)
# ---------- python_script.python (88 lines) ----------
# Default imports
import clr

# Import RevitAPI
clr.AddReference("RevitAPI")
import Autodesk
from Autodesk.Revit.DB import *

# Import DocumentManager and TransactionManager
clr.AddReference("RevitServices")
import RevitServices
from RevitServices.Persistence import DocumentManager
from RevitServices.Transactions import TransactionManager

# Import ToDSType(bool) extension method
clr.AddReference("RevitNodes")
import Revit
clr.ImportExtensions(Revit.Elements)

#The input to this node will be stored in the IN[0] variable.

doc =  DocumentManager.Instance.CurrentDBDocument
app =  DocumentManager.Instance.CurrentUIApplication.Application

solids = IN[0]

faces = []
edges = []
vertices = []
if hasattr(solids, "__iter__"):
	for solid in solids:
		if hasattr(solid, "__iter__"):
			for sol in solid:
				fcs = []
				edgs = []
				verts = []
				for face in solid.Faces:
					fcs.append(face)
	
				for edge in solid.Edges:
					crv = edge.AsCurve()
					edgs.append(crv)
		
					pt = crv.Evaluate(0, True)
					verts.append(pt)
		
				faces.append(fcs)
				edges.append(edgs)
				vertices.append(verts)
		else:
			fcs = []
			edgs = []
			verts = []
			for face in solid.Faces:
				fcs.append(face)
	
			for edge in solid.Edges:
				crv = edge.AsCurve()
				edgs.append(crv)
		
				pt = crv.Evaluate(0, True)
				verts.append(pt)
		
			faces.append(fcs)
			edges.append(edgs)
			vertices.append(verts)
else:
	fcs = []
	edgs = []
	verts = []
	for face in solids.Faces:
		fcs.append(face)
	
	
	faces.append(fcs)
	edges.append(edgs)
	vertices.append(verts)

	
	
output = []
output.append(faces)
output.append(edges)
output.append(vertices)
	

#Assign your output to the OUT variable
OUT = output
# ----------------------------------------
flatten_4 = Flatten(python_script)
class_ = Custom[Object.Class](obj=flatten_4)  # Gets the input object's class name. Can process lists.
code_block_5 = CodeBlock { "Face"; }
contains = String.Contains(str=class_.class_str, searchFor=code_block_5)
filterByBoolMask = List.FilterByBoolMask(list=flatten_3, mask=contains)
watch_2 = Watch(flatten)
code_block_6 = CodeBlock { 1; }
getItemAtIndex = List.GetItemAtIndex(index=code_block_6)  # unwired: list
map = List.Map(list=deconstructSurface.out1, f_x=getItemAtIndex)
explode = Geometry.Explode(importFromSAT)
area = Solid.Area(explode)
code_block_7 = CodeBlock { 4000000; }
div = area / code_block_7
integer_slider = IntegerSlider(1, range=0..100 step 1)
getItemAtIndex_2 = List.GetItemAtIndex(list=explode, index=integer_slider)
