# Dynamo graph Gsa Surfaces05.dyn (Dynamo 1.2.0.2514)

select_model_elements = DSModelElementsSelection()  # 22 picked in the model
watch = Watch(select_model_elements)
file_path = Filename("..\..\..\..\Desktop\Test.txt")
gsa_header = Custom[GSA Header]()
geometry = Element.Geometry(select_model_elements)
flatten = Flatten(geometry)
class_ = Custom[Object.Class](obj=flatten)  # Gets the input object's class name. Can process lists.
code_block = CodeBlock { "Surface"; }
contains = String.Contains(str=class_.class_str, searchFor=code_block)
filterByBoolMask = List.FilterByBoolMask(list=flatten, mask=contains)
code_block_2 = CodeBlock { 7; }
area = Solid.Area(filterByBoolMask.in)
code_block_3 = CodeBlock { 10.795; }
div = area / code_block_3
panelQuad = Geometry.Panel.PanelQuad(filterByBoolMask.in, code_block_2, div)
deconstructSurface = Geometry.Surfaces.DeconstructSurface(panelQuad)
code_block_4 = CodeBlock { 1; }
flatten_2 = List.Flatten(list=deconstructSurface.out1, amt=code_block_4)
flatten_3 = Flatten(flatten_2)
code_block_5 = CodeBlock { 0; }
pruneDuplicates = Point.PruneDuplicates(points=flatten_3, tolerance=code_block_5)
gsa_points = Custom[GSA Points](Points=pruneDuplicates)
gsa_walls = Custom[GSA Walls](Point_List=pruneDuplicates, Surface_Points=flatten_2)
string = StringInput("\n")
code_block_6 = CodeBlock(a=deconstructSurface.out0) { List.MinimumItem(a.EndPoint.Z); }
flatten_4 = Flatten(code_block_6)
uniqueItems = List.UniqueItems(flatten_4)
code_block_7 = CodeBlock(b=uniqueItems) { b[0]; }
code_block_8 = CodeBlock(a=deconstructSurface.out0, b=code_block_7) { a.EndPoint.Z==b; }
filterByBoolMask_2 = List.FilterByBoolMask(list=deconstructSurface.out0, mask=code_block_8)
code_block_9 = CodeBlock(a=filterByBoolMask_2.in, b=code_block_7) { a.StartPoint.Z==b; }
filterByBoolMask_3 = List.FilterByBoolMask(list=filterByBoolMask_2.in, mask=code_block_9)
flatten_5 = Flatten(filterByBoolMask_3.in)
gsa_lines = Custom[GSA Lines](Point=pruneDuplicates, Curve=flatten_5)
code_block_10 = CodeBlock(a=flatten_5) { 1..Count(a); }
string_from_array = FromArray(code_block_10)
code_block_11 = CodeBlock { "{"; }
string_2 = StringInput("")
replace = String.Replace(str=string_from_array, searchFor=code_block_11, replaceWith=string_2)
code_block_12 = CodeBlock { "}"; }
replace_2 = String.Replace(str=replace, searchFor=code_block_12, replaceWith=string_2)
code_block_13 = CodeBlock { ","; }
code_block_14 = CodeBlock { " "; }
replace_3 = String.Replace(str=replace_2, searchFor=code_block_13, replaceWith=code_block_14)
py_area = Python(IN[0]=replace_3)
# ---------- py_area.python (9 lines) ----------
import clr
clr.AddReference('ProtoGeometry')
from Autodesk.DesignScript.Geometry import *
#The inputs to this node will be stored as a list in the IN variables.

LineList = IN[0]


OUT = str("AREA	1		NO_RGB	TWO_WAY	0.000000	1	1	" + LineList + "	0.000000")
# ----------------------------------------
gsa_footers = Custom[GSA Footers]()
concat = String.Concat(gsa_header, gsa_points, gsa_walls, string, gsa_lines, string, py_area, gsa_footers)
writeText = File.WriteText(file_path, concat)
restOfItems = List.RestOfItems(flatten)
watch_2 = Watch(deconstructSurface.out0)
