# Dynamo graph Gsa Surfaces06.dyn (Dynamo 1.2.0.2514)

file_path = Filename("..\..\..\..\Desktop\Test.txt")
gsa_header = Custom[GSA Header]()
select_model_elements = DSModelElementsSelection()  # 8 picked in the model
geometry = Element.Geometry(select_model_elements)
flatten = Flatten(geometry)
class_ = Custom[Object.Class](obj=flatten)  # Gets the input object's class name. Can process lists.
code_block = CodeBlock { "Surface"; }
contains = String.Contains(str=class_.class_str, searchFor=code_block)
filterByBoolMask = List.FilterByBoolMask(list=flatten, mask=contains)
code_block_2 = CodeBlock { 6; }
area = Solid.Area(filterByBoolMask.in)
code_block_3 = CodeBlock { 4; }
a_h_wall_length = area / code_block_3
in_panel_width = CodeBlock { 0.5; }
div = a_h_wall_length / in_panel_width
ceiling = Math.Ceiling(div)
panelQuad = Geometry.Panel.PanelQuad(filterByBoolMask.in, code_block_2, ceiling)
deconstructSurface = Geometry.Surfaces.DeconstructSurface(panelQuad)
code_block_4 = CodeBlock { 1; }
flatten_2 = List.Flatten(list=deconstructSurface.out1, amt=code_block_4)
flatten_3 = Flatten(flatten_2)
code_block_5 = CodeBlock { 0; }
pruneDuplicates = Point.PruneDuplicates(points=flatten_3, tolerance=code_block_5)
select_model_elements_2 = DSModelElementsSelection()  # 3 picked in the model
geometry_2 = Element.Geometry(select_model_elements_2)
gsa_create_analytical_sticks = Custom[GSA Create Analytical Sticks](Revit_Element=geometry_2)
create = List.Create(pruneDuplicates, gsa_create_analytical_sticks.End_Points, gsa_create_analytical_sticks.Start_Points)
flatten_4 = Flatten(create)
gsa_points = Custom[GSA Points](Points=flatten_4)
gsa_walls = Custom[GSA Walls](Point_List=pruneDuplicates, Surface_Points=flatten_2)
code_block_6 = CodeBlock { 0; }
code_block_7 = CodeBlock(a=deconstructSurface.out0, b=code_block_6) { a.EndPoint.Z==b; }
filterByBoolMask_2 = List.FilterByBoolMask(list=deconstructSurface.out0, mask=code_block_7)
code_block_8 = CodeBlock(a=filterByBoolMask_2.in, b=code_block_6) { a.StartPoint.Z==b; }
filterByBoolMask_3 = List.FilterByBoolMask(list=filterByBoolMask_2.in, mask=code_block_8)
flatten_5 = Flatten(filterByBoolMask_3.in)
simplify = Custom[CurveLoop.Simplify](curveLoop=flatten_5)  # Attempts to simplify an open or a closed curve loop by connecting straight separate line segments into a single line.
gsa_lines = Custom[GSA Lines](Point=pruneDuplicates, Curve=simplify)
code_block_9 = CodeBlock(a=flatten_5) { 1..Count(a); }
string_from_array = FromArray(code_block_9)
code_block_10 = CodeBlock { "{"; }
string = StringInput("")
replace = String.Replace(str=string_from_array, searchFor=code_block_10, replaceWith=string)
code_block_11 = CodeBlock { "}"; }
replace_2 = String.Replace(str=replace, searchFor=code_block_11, replaceWith=string)
code_block_12 = CodeBlock { ","; }
code_block_13 = CodeBlock { " "; }
replace_3 = String.Replace(str=replace_2, searchFor=code_block_12, replaceWith=code_block_13)
py_area = Python(IN[0]=replace_3)
# ---------- py_area.python (9 lines) ----------
import clr
clr.AddReference('ProtoGeometry')
from Autodesk.DesignScript.Geometry import *
#The inputs to this node will be stored as a list in the IN variables.

LineList = IN[0]


OUT = str("\nAREA	1		NO_RGB	TWO_WAY	0.000000	1	1	" + LineList + "	0.000000\n")
# ----------------------------------------
gsa_region_definition = Custom[GSA Region Definition](Points=flatten_4, Fixed_Nodes=gsa_create_analytical_sticks.End_Points)
gsa_footers = Custom[GSA Footers]()
concat = String.Concat(gsa_header, gsa_points, gsa_walls, gsa_lines, py_area, gsa_region_definition, gsa_footers)
writeText = File.WriteText(file_path, concat)
watch = Watch(deconstructSurface.out0)
code_block_14 = CodeBlock(a=deconstructSurface.out0) { List.MinimumItem(a.EndPoint.Z); }
flatten_6 = Flatten(code_block_14)
uniqueItems = List.UniqueItems(flatten_6)
code_block_15 = CodeBlock(b=uniqueItems) { b[0]; }
create_2 = List.Create(gsa_create_analytical_sticks.Elements)
code_block_16 = CodeBlock { 2; }
create_3 = List.Create(code_block_16)
code_block_17 = CodeBlock { 500; }
gsa_beam_elements = Custom[GSA Beam Elements](Point=flatten_4, Curve=create_2, EL_Properties=create_3, Element_Counter_Start=code_block_17)
concat_2 = String.Concat(gsa_header, gsa_points, gsa_beam_elements, gsa_footers)
