# Dynamo graph Gsa.dyn (Dynamo 1.2.0.2514)

select_model_elements = DSModelElementsSelection()  # 6 picked in the model
watch = Watch(select_model_elements)
file_path = Filename("..\..\..\..\Desktop\Test.txt")
gsa_header = Custom[GSA Header]()
geometry = Element.Geometry(select_model_elements)
code_block = CodeBlock { 0; }
getItemAtIndex = List.GetItemAtIndex(index=code_block)  # unwired: list
map = List.Map(list=geometry, f_x=getItemAtIndex)
deconstructSurface = Geometry.Surfaces.DeconstructSurface(map)
flatten = Flatten(deconstructSurface.out1)
code_block_2 = CodeBlock { 0; }
pruneDuplicates = Point.PruneDuplicates(points=flatten, tolerance=code_block_2)
gsa_points = Custom[GSA Points](Points=pruneDuplicates)
gsa_footers = Custom[GSA Footers]()
concat = String.Concat(gsa_header, gsa_points, gsa_footers)
writeText = File.WriteText(file_path, concat)
