# Dynamo graph RC Python Scripts01.dyn (Dynamo 2.0.0.3911)

code_block = CodeBlock { 30; }
code_block_2 = CodeBlock { 400; }
code_block_3 = CodeBlock { 200000; }
code_block_4 = CodeBlock { {300,400,500}; }
code_block_5 = CodeBlock { {500,600,700}; }
code_block_6 = CodeBlock(a=code_block_4) { a/a*65; }
code_block_7 = CodeBlock(b=code_block_5) { b-65; }
m_n_diagram = Custom[M-N Diagram](Concrete_Grade=code_block, Steel_Grade=code_block_2, Es=code_block_3, b=code_block_4, H=code_block_5, Top_Cover=code_block_6, d=code_block_7, lacing=Longest)

# group: M
maximumItem = List.MaximumItem(m_n_diagram.M)
minimumItem = List.MinimumItem(m_n_diagram.M)

code_block_8 = CodeBlock { 1000; }
code_block_9 = CodeBlock(a=code_block_8) { Line.ByStartPointEndPoint(Point.ByCoordinates(0,0,0),Point.ByCoordinates(a,0,0)); }
code_block_10 = CodeBlock(a=code_block_8) { Line.ByStartPointEndPoint(Point.ByCoordinates(0,0,0),Point.ByCoordinates(0,a,0)); }
code_block_11 = CodeBlock(a=code_block_9, b=code_block_10) { {a,b}; }
red = DynamoPDF.Content.Colors.Red()
byGeometryColor = Display.Display.ByGeometryColor(code_block_11, red)
byCoordinates = Point.ByCoordinates(x=m_n_diagram.M, y=m_n_diagram.N)
byControlPoints = NurbsCurve.ByControlPoints(byCoordinates)
navy = Custom[Color.Navy]()  # Returns the colour navy.
fuchsia = Custom[Color.Fuchsia]()  # Returns the colour fuchsia a.k.a. magenta.
yellow = Custom[Color.Yellow]()  # Returns the colour yellow.
join = List.Join(navy, fuchsia, yellow)
byGeometryColor_2 = Display.Display.ByGeometryColor(byControlPoints, join)
code_block_12 = CodeBlock { -1200..1200..100; }
code_block_13 = CodeBlock { -200..900..100; }
byCoordinates_2 = Point.ByCoordinates(x=code_block_12, y=code_block_13, lacing=CrossProduct)
silver = Custom[Color.Silver]()  # Returns the colour silver.
byGeometryColor_3 = Display.Display.ByGeometryColor(byCoordinates_2, silver)

# group: N
maximumItem_2 = List.MaximumItem(m_n_diagram.N)
minimumItem_2 = List.MinimumItem(m_n_diagram.N)

# group: POINT TO CHECK
code_block_14 = CodeBlock { 450; 250; }
byCoordinates_3 = Point.ByCoordinates(x=code_block_14.out0, y=code_block_14.out1)
red_2 = DynamoPDF.Content.Colors.Red()
byGeometryColor_4 = Display.Display.ByGeometryColor(byCoordinates_3, red_2)

code_block_15 = CodeBlock { 30; }
code_block_16 = CodeBlock { 500; }
code_block_17 = CodeBlock { 200000; }
code_block_18 = CodeBlock { {300,400,500}; }
code_block_19 = CodeBlock { {500,600,700}; }
code_block_20 = CodeBlock(a=code_block_18) { a/a*65; }
code_block_21 = CodeBlock(b=code_block_19) { b-65; }
m_n_diagram_2 = Custom[M-N Diagram](Concrete_Grade=code_block_15, Steel_Grade=code_block_16, Es=code_block_17, b=code_block_18, H=code_block_19, Top_Cover=code_block_20, d=code_block_21, lacing=Longest)  # frozen
minimumItem_3 = List.MinimumItem(m_n_diagram_2.N)
minimumItem_4 = List.MinimumItem(m_n_diagram_2.M)
byCoordinates_4 = Point.ByCoordinates()
maximumItem_3 = List.MaximumItem(m_n_diagram_2.M)
byCoordinates_5 = Point.ByCoordinates(x=maximumItem_3)
byStartPointEndPoint = Line.ByStartPointEndPoint(startPoint=byCoordinates_4, endPoint=byCoordinates_5)
endPoint = Curve.EndPoint(byStartPointEndPoint)
byCoordinates_6 = Point.ByCoordinates(x=m_n_diagram_2.M, y=m_n_diagram_2.N)
byControlPoints_2 = NurbsCurve.ByControlPoints(byCoordinates_6)
navy_2 = Custom[Color.Navy]()
fuchsia_2 = Custom[Color.Fuchsia]()
yellow_2 = Custom[Color.Yellow]()
join_2 = List.Join(navy_2, fuchsia_2, yellow_2)
byGeometryColor_5 = Display.Display.ByGeometryColor(byControlPoints_2, join_2)
byCoordinates_7 = Point.ByCoordinates()
maximumItem_4 = List.MaximumItem(m_n_diagram_2.N)
byCoordinates_8 = Point.ByCoordinates(y=maximumItem_4)
byStartPointEndPoint_2 = Line.ByStartPointEndPoint(startPoint=byCoordinates_7, endPoint=byCoordinates_8)
endPoint_2 = Curve.EndPoint(byStartPointEndPoint_2)
