# Dynamo graph Read GSA Beams and Columns.dyn (Dynamo 1.2.1.3083)

# group: GUIDLINES
# note: Copy Nodes, Elements and Properties from GSA to Excel.
# This script recreates the centrelines of the GSA Elements and uses Structural Framing by Curve to create the Structural Framings in Revit and Structural Column by Curve to create Structural Columns.
# Note:
# When matching the Revit families, make sure they have the same name (I found CHS in GSA identified as CHS245x14.2 while in Revit they are called CHS244.5x14.2 #).
# note: Created by: Giovanni Brogiolo - BEL B London
# Date: January 2017
# Dynamo 1.2.1
# PACKAGES
# Lunchbox fo Remove Nulls

# group: SELECT THE ELEMENTS SHEET IN EXCEL
file_path = Filename(".\GSA%20model.xlsx")
code_block = CodeBlock { "EL"; }

# group: Get GSA Elements Information
fromPath = FileObject(file_path)  # "File.FromPath"
code_block_2 = CodeBlock { 0; }
readFromFile = Excel.ReadFromFile(file=fromPath, sheetName=code_block, readAsStrings=code_block_2)
transpose = List.Transpose(readFromFile)
# note: Element Number
code_block_3 = CodeBlock(a=transpose) { a[1]; }
# note: Node1
code_block_4 = CodeBlock(a=transpose) { a[7]; }
# note: Node2
code_block_5 = CodeBlock(a=transpose) { a[8]; }
# note: Property
code_block_6 = CodeBlock(a=transpose) { a[5]; }
# note: Section Rotation
code_block_7 = CodeBlock(a=transpose) { a[10]; }

# group: SELECT THE NODES SHEET IN EXCEL
file_path_2 = Filename(".\GSA%20model.xlsx")
code_block_8 = CodeBlock { "Nodes"; }

# group: Creates Points from GSA Nodes
fromPath_2 = FileObject(file_path_2)  # "File.FromPath"
code_block_9 = CodeBlock { 0; }
readFromFile_2 = Excel.ReadFromFile(file=fromPath_2, sheetName=code_block_8, readAsStrings=code_block_9)
transpose_2 = List.Transpose(readFromFile_2)
# note: X
code_block_10 = CodeBlock(a=transpose_2) { a[4]; }
# note: Y
code_block_11 = CodeBlock(a=transpose_2) { a[5]; }
# note: Z
code_block_12 = CodeBlock(a=transpose_2) { a[6]; }
byCoordinates = Point.ByCoordinates(x=code_block_10, y=code_block_11, z=code_block_12)
# note: Node Number
code_block_13 = CodeBlock(a=transpose_2) { a[1]; }

# group: Recreate Element centrelines
indexOf = IndexOf(code_block_13)  # unwired: arg1
map = List.Map(list=code_block_4, f_x=indexOf)
getItemAtIndex = List.GetItemAtIndex(list=byCoordinates, index=map)
indexOf_2 = IndexOf(code_block_13)  # unwired: arg1
map_2 = List.Map(list=code_block_5, f_x=indexOf_2)
getItemAtIndex_2 = List.GetItemAtIndex(list=byCoordinates, index=map_2)
byStartPointEndPoint = Line.ByStartPointEndPoint(startPoint=getItemAtIndex, endPoint=getItemAtIndex_2)

# group: SELECT THE PROPERTIES SHEET IN EXCEL
file_path_3 = Filename(".\GSA%20model.xlsx")
code_block_14 = CodeBlock { "Properties"; }

# group: Get GSA Properties
fromPath_3 = FileObject(file_path_3)  # "File.FromPath"
code_block_15 = CodeBlock { 0; }
readFromFile_3 = Excel.ReadFromFile(file=fromPath_3, sheetName=code_block_14, readAsStrings=code_block_15)
transpose_3 = List.Transpose(readFromFile_3)
# note: Property
code_block_16 = CodeBlock(list=transpose_3) { list[1]; }
# note: Type
code_block_17 = CodeBlock(list=transpose_3) { list[2]; }
# note: Description
code_block_18 = CodeBlock(list=transpose_3) { list[5]; }
code_block_19 = CodeBlock { "%"; }
split = String.Split(code_block_18, code_block_19)
watch = Watch(split)
code_block_20 = CodeBlock { 2; }
getItemAtIndex_3 = List.GetItemAtIndex(list=watch, index=code_block_20, lacing=Longest)
bv_remove_nulls = Custom[bv Remove Nulls](List=getItemAtIndex_3)  # forked from Lunchbox

# group: FIND COLUMNS (BASED ON SECTION PROPERTY NAME). GSA LIST BASED SELECTION WOULD WORK BETTER.
code_block_21 = CodeBlock { "Column"; }
code_block_22 = CodeBlock { 1; }
contains = String.Contains(str=code_block_17, searchFor=code_block_21, ignoreCase=code_block_22)
filterByBoolMask = List.FilterByBoolMask(list=code_block_16, mask=contains)
indexOf_3 = IndexOf(filterByBoolMask.in)  # unwired: arg1
map_3 = List.Map(list=code_block_6, f_x=indexOf_3)
code_block_23 = CodeBlock(a=map_3) { a==-1; }
code_block_24 = CodeBlock { false; }
code_block_25 = CodeBlock { true; }
if_ = If(test=code_block_23, true=code_block_24, false=code_block_25)

# group: DIVIDE BEAMS FROM COLUMNS
# note: Columns
# note: Beams
filterByBoolMask_2 = List.FilterByBoolMask(list=byStartPointEndPoint, mask=if_)

# group: SET THE PLACEMENT LEVEL
levels = Levels("00")

# group: Match GSA Properties with Revit Framing Families
# note: Select all Structural Framings Families in Revit
python_script = Python()  # unwired: IN[0]
# ---------- python_script.python (22 lines) ----------
import clr
clr.AddReference('ProtoGeometry')
from Autodesk.DesignScript.Geometry import *

# Import RevitAPI
clr.AddReference("RevitAPI")
import Autodesk
from Autodesk.Revit.DB import *

# Import RevitAPI
clr.AddReference("RevitServices")
import RevitServices
from RevitServices.Persistence import DocumentManager

#The inputs to this node will be stored as a list in the IN variables.
doc = DocumentManager.Instance.CurrentDBDocument
cat = doc.Settings.Categories

collector = FilteredElementCollector(doc).OfCategory(BuiltInCategory.OST_StructuralFraming)

#Assign your output to the OUT variable.
OUT = [i for i in collector]
# ----------------------------------------
indexOf_4 = IndexOf(code_block_16)  # unwired: arg1
map_4 = List.Map(list=code_block_6, f_x=indexOf_4)
getItemAtIndex_4 = List.GetItemAtIndex(list=bv_remove_nulls, index=map_4)
name = Family.Name(python_script)
bv_remove_nulls_2 = Custom[bv Remove Nulls](List=name)
indexOf_5 = IndexOf(bv_remove_nulls_2)  # unwired: arg1
map_5 = List.Map(list=getItemAtIndex_4, f_x=indexOf_5)
getItemAtIndex_5 = List.GetItemAtIndex(list=python_script, index=map_5)
filterByBoolMask_3 = List.FilterByBoolMask(list=getItemAtIndex_5, mask=if_)

# group: Create the structural framings
beamByCurve = StructuralFraming.BeamByCurve(curve=filterByBoolMask_2.out, level=levels, structuralFramingType=filterByBoolMask_3.out)

# group: Override in view the structural framings colours as per GSA Properties
code_block_26 = CodeBlock(list=code_block_16) { Count(list); }
randomList = Math.RandomList(code_block_26)
randomList_2 = Math.RandomList(code_block_26)
code_block_27 = CodeBlock(i=randomList, k=randomList_2) { 255; i*255; k*255; }
byARGB = Color.ByARGB(a=code_block_27.out0, r=code_block_27.out0, g=code_block_27.out1, b=code_block_27.out2)
filterByBoolMask_4 = List.FilterByBoolMask(list=map_4, mask=if_)
getItemAtIndex_6 = List.GetItemAtIndex(list=byARGB, index=filterByBoolMask_4.out)
overrideColorInView = Element.OverrideColorInView(element=beamByCurve, color=getItemAtIndex_6)

# group: DIVIDE BEAMS AND COLUMNS SECTION ROTATION
# note: Beams
# note: Columns
filterByBoolMask_5 = List.FilterByBoolMask(list=code_block_7, mask=if_)

# group: Set beam cross-section rotation
code_block_28 = CodeBlock { "Cross-Section Rotation"; }
setParameterByName = Element.SetParameterByName(element=beamByCurve, parameterName=code_block_28, value=filterByBoolMask_5.out)

# group: Match GSA Properties with Revit Columns Families
# note: Select all Structural Columns Families in Revit
python_script_2 = Python()  # unwired: IN[0]
# ---------- python_script_2.python (22 lines) ----------
import clr
clr.AddReference('ProtoGeometry')
from Autodesk.DesignScript.Geometry import *

# Import RevitAPI
clr.AddReference("RevitAPI")
import Autodesk
from Autodesk.Revit.DB import *

# Import RevitAPI
clr.AddReference("RevitServices")
import RevitServices
from RevitServices.Persistence import DocumentManager

#The inputs to this node will be stored as a list in the IN variables.
doc = DocumentManager.Instance.CurrentDBDocument
cat = doc.Settings.Categories

collector = FilteredElementCollector(doc).OfCategory(BuiltInCategory.OST_StructuralColumns)

#Assign your output to the OUT variable.
OUT = [i for i in collector]
# ----------------------------------------
indexOf_6 = IndexOf(code_block_16)  # unwired: arg1
map_6 = List.Map(list=code_block_6, f_x=indexOf_6)
getItemAtIndex_7 = List.GetItemAtIndex(list=bv_remove_nulls, index=map_6)
name_2 = Family.Name(python_script_2)
bv_remove_nulls_3 = Custom[bv Remove Nulls](List=name_2)
indexOf_7 = IndexOf(bv_remove_nulls_3)  # unwired: arg1
map_7 = List.Map(list=getItemAtIndex_7, f_x=indexOf_7)
getItemAtIndex_8 = List.GetItemAtIndex(list=python_script_2, index=map_7)
filterByBoolMask_6 = List.FilterByBoolMask(list=getItemAtIndex_8, mask=if_)
bv_remove_nulls_4 = Custom[bv Remove Nulls](List=filterByBoolMask_6.in)

# group: Create the structural columns
columnByCurve = StructuralFraming.ColumnByCurve(curve=filterByBoolMask_2.in, level=levels, structuralColumnType=bv_remove_nulls_4)

# group: Set column cross-section rotation
code_block_29 = CodeBlock { "Cross-Section Rotation"; }
setParameterByName_2 = Element.SetParameterByName(element=columnByCurve, parameterName=code_block_29, value=filterByBoolMask_5.in)

# group: ELEMENTS COUNT
code_block_30 = CodeBlock(a=filterByBoolMask_2.in, b=filterByBoolMask_2.out) { Count(a); Count(b); }
watch_2 = Watch(code_block_30.out0)
watch_3 = Watch(code_block_30.out1)

# group: Override in view the structural framings colours as per GSA Properties
code_block_31 = CodeBlock(list=code_block_16) { Count(list); }
randomList_3 = Math.RandomList(code_block_31)
randomList_4 = Math.RandomList(code_block_31)
code_block_32 = CodeBlock(i=randomList_3, k=randomList_4) { 255; i*255; k*255; }
byARGB_2 = Color.ByARGB(a=code_block_32.out0, r=code_block_32.out0, g=code_block_32.out1, b=code_block_32.out2)
filterByBoolMask_7 = List.FilterByBoolMask(list=map_4, mask=if_)
getItemAtIndex_9 = List.GetItemAtIndex(list=byARGB_2, index=filterByBoolMask_7.in)
overrideColorInView_2 = Element.OverrideColorInView(element=columnByCurve, color=getItemAtIndex_9)
