# Dynamo graph gsaBeamDataExtractor.dyn (Dynamo 1.3.1.1736)

# group: Read GSA file (this can be done also through Excel)
file_path = Filename("C:\Users\giovanni.brogiolo\Desktop\03ModelSM.gwb")
openGsaFile = ReadGsa.Core.OpenGsaFile(file_path)
openGsaFile_2 = ReadGsa.Core.OpenGsaFile(file_path)
code_block = CodeBlock { "all"; }
elements = ReadGsa.GSAElements.Elements(openGsaFile_2, code_block)
nodesFromRefs = ReadGsa.GSANodes.NodesFromRefs(openGsaFile_2, elements.out1)
code_block_2 = CodeBlock(a=nodesFromRefs.out1) { a; }
deconstruct = List.Deconstruct(list=code_block_2, lacing=Longest)
byStartPointEndPoint = Line.ByStartPointEndPoint(startPoint=deconstruct.first, endPoint=deconstruct.rest)
code_block_3 = CodeBlock { 0.5; }
pointAtParameter = Curve.PointAtParameter(curve=byStartPointEndPoint, param=code_block_3)

file_path_2 = Filename("..\Desktop\171103GsaExtraction")
code_block_4 = CodeBlock { {"BeamCentrepoints","Beam References","Node Refs"}; }
code_block_5 = CodeBlock { 0; }

# group: GSA beams centre points
flatten = Flatten(pointAtParameter)

code_block_6 = CodeBlock(a=flatten) { {a.X,a.Y,a.Z}; }

# group: GSA beam references
code_block_7 = CodeBlock(a=elements.out0) { a; }

code_block_8 = CodeBlock(BeamCentrepoints=code_block_6, BeamReferences=code_block_7, NodeRefs=nodesFromRefs.out0) { {BeamCentrepoints,BeamReferences,NodeRefs}; }
code_block_9 = CodeBlock { 1; }
writeToFile = Excel.WriteToFile(filePath=file_path_2, sheetName=code_block_4, startRow=code_block_5, startCol=code_block_5, data=code_block_8, overWrite=code_block_9)
type = Object.Type(flatten)
