# Dynamo graph gsaBeamMatcher.dyn (Dynamo 1.3.1.1736)

# group: Read GSA file (this can be done also through Excel)
file_path = Filename("C:\Users\giovanni.brogiolo\Desktop\03ModelSM.gwb")
openGsaFile = ReadGsa.Core.OpenGsaFile(file_path)
openGsaFile_2 = ReadGsa.Core.OpenGsaFile(file_path)
code_block = CodeBlock { "all"; }
elements = ReadGsa.GSAElements.Elements(openGsaFile_2, code_block)
nodesFromRefs = ReadGsa.GSANodes.NodesFromRefs(openGsaFile_2, elements.out1)
code_block_2 = CodeBlock(a=nodesFromRefs.out1) { a; }
deconstruct = List.Deconstruct(list=code_block_2, lacing=Longest)
byStartPointEndPoint = Line.ByStartPointEndPoint(startPoint=deconstruct.first, endPoint=deconstruct.rest)
code_block_3 = CodeBlock { 0.5; }
pointAtParameter = Curve.PointAtParameter(curve=byStartPointEndPoint, param=code_block_3)

# group: Select Revit beams and find their centre points
select_model_elements = DSModelElementsSelection()
location = StructuralFraming.Location(select_model_elements)
code_block_4 = CodeBlock { 0.5; }
pointAtParameter_2 = Curve.PointAtParameter(curve=location, param=code_block_4)

# group: GSA beam references
code_block_5 = CodeBlock(a=elements.out0) { a; }

# group: GSA beams centre points
flatten = Flatten(pointAtParameter)

# group: Check the minimum distance between centre points and find the corresponding GSA beam reference
distanceTo = Geometry.DistanceTo(geometry=pointAtParameter_2, other=flatten, lacing=CrossProduct)
minimumItem = List.MinimumItem(distanceTo)
allIndicesOf = List.AllIndicesOf(list=distanceTo, item=minimumItem, lacing=Longest)
getItemAtIndex = List.GetItemAtIndex(list=code_block_5, index=allIndicesOf)

# group: Get the GSA beam start and end points
getItemAtIndex_2 = List.GetItemAtIndex(list=nodesFromRefs.out0, index=allIndicesOf)
string_from_object = FromObject(getItemAtIndex_2)
flatten_2 = Flatten(string_from_object@L2)

# group: Write the GSA beam reference in the Revit beam
code_block_6 = CodeBlock { {{"GSA Member Reference","Start Point", "End Point"}}; }
string_from_object_2 = FromObject(getItemAtIndex)
flatten_3 = Flatten(string_from_object_2)
addItemToFront = List.AddItemToFront(item=flatten_3, list=flatten_2, lacing=Longest)
setParameterByName = Element.SetParameterByName(element=select_model_elements, parameterName=code_block_6, value=addItemToFront, lacing=Longest)
