# Dynamo graph gsaBeamMatcherV08.dyn (Dynamo 0.8.2.2392)

# group: Select Revit beams and find their centre points
select_model_elements = DSModelElementsSelection()
location = StructuralFraming.Location(select_model_elements)
code_block = CodeBlock { 0.5; }
pointAtParameter = Curve.PointAtParameter(curve=location, param=code_block)

string = StringInput("C:\Users\giovanni.brogiolo\Desktop\New folder\03ModelExtraction.xlsx")
fromPath = FileObject(string)  # "File.FromPath"
code_block_2 = CodeBlock { {"BeamCentrepoints","Beam References","Node Refs"}; }
code_block_3 = CodeBlock { false; }
readFromFile = Excel.ReadFromFile(file=fromPath, sheetName=code_block_2, readAsStrings=code_block_3, lacing=Longest)

# group: GSA beams references
code_block_4 = CodeBlock(data=readFromFile) { data[1]; }

code_block_5 = CodeBlock(a=readFromFile) { a[0]; }
transpose = List.Transpose(code_block_5)
python_script = Python(IN[0]=transpose)
# ---------- python_script.python (12 lines) ----------
import clr
clr.AddReference('ProtoGeometry')
from Autodesk.DesignScript.Geometry import *
#The inputs to this node will be stored as a list in the IN variables.
pts = IN[0]
points = []

for i in range(0,len(pts)):
	points.append(Point.ByCoordinates(pts[i][0],pts[i][1],pts[i][2]))

#Assign your output to the OUT variable.
OUT = points
# ----------------------------------------

# group: GSA beams centre points
code_block_6 = CodeBlock(GSAbeamsCenterPoints=python_script) { GSAbeamsCenterPoints; }

distanceTo = Geometry.DistanceTo(geometry=pointAtParameter, other=code_block_6, lacing=CrossProduct)
minimumItem = List.MinimumItem(distanceTo, lacing=Longest)
allIndicesOf = List.AllIndicesOf(list=distanceTo, item=minimumItem, lacing=Longest)
getItemAtIndex = List.GetItemAtIndex(list=code_block_4, index=allIndicesOf)

# group: Write the GSA beam reference in the Revit beam
setParameterByName = Element.SetParameterByName(element=select_model_elements)
code_block_7 = CodeBlock { {"GSA RefToRevit","GSA End1", "GSA End2"}; }
addItemToFront = List.AddItemToFront(lacing=Longest)
string_from_object = FromObject(getItemAtIndex)
flatten = Flatten(string_from_object)

# group: GSA node references
code_block_8 = CodeBlock(data=readFromFile) { data[2]; }

# group: Get the GSA beam start and end points
getItemAtIndex_2 = List.GetItemAtIndex(list=code_block_8, index=allIndicesOf)
string_from_object_2 = FromObject(getItemAtIndex_2)
code_block_9 = CodeBlock { 1; }
flatten_2 = List.Flatten(list=string_from_object_2, amt=code_block_9)

combine = List.Combine(addItemToFront, flatten, flatten_2)
transpose_2 = List.Transpose(combine)
combine_2 = List.Combine(setParameterByName, code_block_7, transpose_2)

# group: Write DISTANCE CHECK to Revit
code_block_10 = CodeBlock { "GSA Revit DistanceCheck"; }
flatten_3 = Flatten(minimumItem)
setParameterByName_2 = Element.SetParameterByName(parameterName=code_block_10, value=flatten_3)
