# Dynamo graph gsaPointMatcher.dyn (Dynamo 1.3.1.1736)

file_path = Filename("..\Desktop\03ModelSM.gwb")
openGsaFile = ReadGsa.Core.OpenGsaFile(file_path)
code_block = CodeBlock()
# ---------- code_block.designscript (1 lines) ----------
{1,19..36,59..72,105..111,116..119,126,128,129,138,139,142,146,147,157..160,167..170,179..204,209..215,217,218,224..232,254,255,262..265,285..293,295..303,305..317,319..329,335..340,350..375,427,428,431..436,451,453,454,455,462,465,466,469..474,487..500,514,516,518,520,522,525,527,529,532,559..564,568,569,570,572,573,575..594,596..612,614,615,632..644,648,742,743,744,752,753,766,1262,1263,1292..1306,1337,1472,1481,1509,1589,1599,1601,1606..1609,1614..1633,1638,1639,1640,1642..1646,1651..1681};
# ----------------------------------------
flatten = Flatten(code_block)
nodesFromRefs = ReadGsa.GSANodes.NodesFromRefs(openGsaFile, flatten)
select_model_elements = DSModelElementsSelection()  # 1035 picked in the model
type = Object.Type(select_model_elements)
code_block_2 = CodeBlock { "ReferencePoint"; }
contains = String.Contains(str=type, searchFor=code_block_2)
filterByBoolMask = List.FilterByBoolMask(list=select_model_elements, mask=contains)
geometry = Element.Geometry(filterByBoolMask.in)
flatten_2 = Flatten(geometry)
closestPointTo = Geometry.ClosestPointTo(geometry=flatten_2, other=nodesFromRefs.out1, lacing=CrossProduct)
allIndicesOf = List.AllIndicesOf(list=nodesFromRefs.out1, item=closestPointTo)
flatten_3 = Flatten(allIndicesOf)
code_block_3 = CodeBlock { "Node Number"; }
distanceTo = Geometry.DistanceTo(geometry=flatten_2, other=nodesFromRefs.out1, lacing=CrossProduct)
minimumItem = List.MinimumItem(distanceTo)
allIndicesOf_2 = List.AllIndicesOf(list=distanceTo, item=minimumItem, lacing=Longest)
flatten_4 = Flatten(allIndicesOf_2)
getItemAtIndex = List.GetItemAtIndex(list=nodesFromRefs.out0, index=flatten_4)
setParameterByName = Element.SetParameterByName(element=filterByBoolMask.in, parameterName=code_block_3, value=getItemAtIndex)
