# Dynamo graph nervi.dyn (Dynamo 1.3.1.1736)

intersectAll = Geometry.IntersectAll(lacing=CrossProduct)  # unwired: geometry, others
flatten = Flatten(intersectAll@L3)
number_slider = DoubleSlider(30, range=0..100 step 0.1)
byCenterPointRadius = Circle.ByCenterPointRadius(radius=number_slider)
endPoint = Curve.EndPoint(byCenterPointRadius)
number_slider_2 = DoubleSlider(24, range=0..100 step 0.1)
byCenterPointRadius_2 = Circle.ByCenterPointRadius(radius=number_slider_2)
ZAxis = Vector.ZAxis()
number_slider_3 = DoubleSlider(4, range=0..100 step 0.1)
translate = Geometry.Translate(geometry=byCenterPointRadius_2, direction=ZAxis, distance=number_slider_3)
endPoint_2 = Curve.EndPoint(translate)
number_slider_4 = DoubleSlider(12, range=0..100 step 0.1)
byCenterPointRadius_3 = Circle.ByCenterPointRadius(radius=number_slider_4)
ZAxis_2 = Vector.ZAxis()
number_slider_5 = DoubleSlider(8, range=0..100 step 0.1)
translate_2 = Geometry.Translate(geometry=byCenterPointRadius_3, direction=ZAxis_2, distance=number_slider_5)
endPoint_3 = Curve.EndPoint(translate_2)
byThreePoints = Arc.ByThreePoints(firstPoint=endPoint, secondPoint=endPoint_2, thirdPoint=endPoint_3)
bySweep = Surface.BySweep(byThreePoints, byCenterPointRadius)
code_block = CodeBlock { {0,1}; }
code_block_2 = CodeBlock { {0..1..#54,0..1..#2}; }
getIsoline = Surface.GetIsoline(bySweep, code_block, code_block_2)
code_block_3 = CodeBlock(a=getIsoline) { a[0]; }
code_block_4 = CodeBlock { 0..1..#4; }
pointAtParameter = Curve.PointAtParameter(curve=code_block_3, param=code_block_4, lacing=CrossProduct)
transpose = List.Transpose(pointAtParameter)
code_block_5 = CodeBlock { 0; }
getItemAtIndex = List.GetItemAtIndex(list=transpose, index=code_block_5)
code_block_6 = CodeBlock { 1; }
shiftIndices = List.ShiftIndices(list=getItemAtIndex, amount=code_block_6)
code_block_7 = CodeBlock { 1; }
getItemAtIndex_2 = List.GetItemAtIndex(list=transpose, index=code_block_7)
byStartPointEndPoint = Line.ByStartPointEndPoint(startPoint=shiftIndices, endPoint=getItemAtIndex_2, lacing=Longest)
split = Geometry.Split()  # unwired: geometry, other
getItemAtIndex_3 = List.GetItemAtIndex()  # unwired: list, index
shiftIndices_2 = List.ShiftIndices(list=getItemAtIndex_2, amount=code_block_6)
byStartPointEndPoint_2 = Line.ByStartPointEndPoint(startPoint=getItemAtIndex, endPoint=shiftIndices_2, lacing=Longest)
geometrySplit = Geometry.Intersection.GeometrySplit()  # unwired: arg0, arg1
code_block_8 = CodeBlock(a=geometrySplit) { a[0]; }
flatten_2 = Flatten(code_block_8)
perimeterCurves = Surface.PerimeterCurves(flatten_2)
code_block_9 = CodeBlock { 0; }
getItemAtIndex_4 = List.GetItemAtIndex(list=perimeterCurves, index=code_block_9, lacing=Longest)
code_block_10 = CodeBlock { 2; }
getItemAtIndex_5 = List.GetItemAtIndex(list=perimeterCurves, index=code_block_10, lacing=Longest)
code_block_11 = CodeBlock { 2; }
getItemAtIndex_6 = List.GetItemAtIndex(list=transpose, index=code_block_11)
code_block_12 = CodeBlock { 1; }
shiftIndices_3 = List.ShiftIndices(list=getItemAtIndex_6, amount=code_block_12)
code_block_13 = CodeBlock { 3; }
getItemAtIndex_7 = List.GetItemAtIndex(list=transpose, index=code_block_13)
byStartPointEndPoint_3 = Line.ByStartPointEndPoint(startPoint=shiftIndices_3, endPoint=getItemAtIndex_7, lacing=Longest)
shiftIndices_4 = List.ShiftIndices(list=getItemAtIndex_7, amount=code_block_12)
byStartPointEndPoint_4 = Line.ByStartPointEndPoint(startPoint=shiftIndices_4, endPoint=getItemAtIndex_6, lacing=Longest)
byStartPointEndPoint_5 = Line.ByStartPointEndPoint(startPoint=shiftIndices_2, endPoint=getItemAtIndex_6, lacing=Longest)
byStartPointEndPoint_6 = Line.ByStartPointEndPoint(startPoint=shiftIndices_3, endPoint=getItemAtIndex_2, lacing=Longest)
code_block_14 = CodeBlock { {true,false}; }
count = List.Count(transpose, lacing=Longest)
cycle = List.Cycle(list=code_block_14, amount=count)
filterByBoolMask = List.FilterByBoolMask(list=transpose, mask=cycle)
code_block_15 = CodeBlock(a=filterByBoolMask.in) { a; }
cartesianProduct = List.CartesianProduct()  # unwired: arg0, arg1, arg2
permutations = List.Permutations()  # unwired: arg0, arg1
code_block_16 = CodeBlock(a=transpose) { a[0]; }
code_block_17 = CodeBlock(b=filterByBoolMask.out) { b; }
