# Dynamo graph nervi04.dyn (Dynamo 1.3.0.875)

number_slider = DoubleSlider(30, range=0..100 step 0.1)

# group: circle1
byCenterPointRadius = Circle.ByCenterPointRadius(radius=number_slider)

endPoint = Curve.EndPoint(byCenterPointRadius)
number_slider_2 = DoubleSlider(24, range=0..100 step 0.1)

# group: circle2
byCenterPointRadius_2 = Circle.ByCenterPointRadius(radius=number_slider_2)

ZAxis = Vector.ZAxis()
number_slider_3 = DoubleSlider(4, range=0..100 step 0.1)

# group: move circle2
translate = Geometry.Translate(geometry=byCenterPointRadius_2, direction=ZAxis, distance=number_slider_3)

endPoint_2 = Curve.EndPoint(translate)
number_slider_4 = DoubleSlider(12, range=0..100 step 0.1)

# group: circle3
byCenterPointRadius_3 = Circle.ByCenterPointRadius(radius=number_slider_4)

ZAxis_2 = Vector.ZAxis()
number_slider_5 = DoubleSlider(8, range=0..100 step 0.1)

# group: move circle3
translate_2 = Geometry.Translate(geometry=byCenterPointRadius_3, direction=ZAxis_2, distance=number_slider_5)

endPoint_3 = Curve.EndPoint(translate_2)
byThreePoints = Arc.ByThreePoints(firstPoint=endPoint, secondPoint=endPoint_2, thirdPoint=endPoint_3)
bySweep = Surface.BySweep(byThreePoints, byCenterPointRadius)
code_block = CodeBlock { {0,1}; }
code_block_2 = CodeBlock { {0..1..#108,0..1..#2}; }
getIsoline = Surface.GetIsoline(bySweep, code_block, code_block_2)
code_block_3 = CodeBlock(a=getIsoline) { a[0]; }
code_block_4 = CodeBlock { 0..1..#8; }
pointAtParameter = Curve.PointAtParameter(curve=code_block_3, param=code_block_4, lacing=CrossProduct)
code_block_5 = CodeBlock { 2; }
shiftIndices = List.ShiftIndices(list=pointAtParameter, amount=code_block_5)
pointAtParameter_2 = Curve.PointAtParameter(curve=code_block_3, param=code_block_4, lacing=CrossProduct)
code_block_6 = CodeBlock { 1; }
shiftIndices_2 = List.ShiftIndices(list=pointAtParameter_2, amount=code_block_6)
code_block_7 = CodeBlock { 1; }
dropItems = List.DropItems(list=shiftIndices_2, amount=code_block_7, lacing=Longest)
byStartPointEndPoint = Line.ByStartPointEndPoint(startPoint=shiftIndices, endPoint=dropItems)
code_block_8 = CodeBlock { 1; }
removeItemAtIndex = List.RemoveItemAtIndex(list=byStartPointEndPoint, indices=code_block_8)
byStartPointEndPoint_2 = Line.ByStartPointEndPoint(startPoint=pointAtParameter, endPoint=dropItems)
code_block_9 = CodeBlock { 0; }
removeItemAtIndex_2 = List.RemoveItemAtIndex(list=byStartPointEndPoint_2, indices=code_block_9)
number_slider_6 = DoubleSlider(39, range=0..100 step 0.1)

# group: circle5
byCenterPointRadius_4 = Circle.ByCenterPointRadius(radius=number_slider_6)

ZAxis_3 = Vector.ZAxis()
number_slider_7 = DoubleSlider(-6, range=-6..100 step 0.1)

# group: move circle5
translate_3 = Geometry.Translate(geometry=byCenterPointRadius_4, direction=ZAxis_3, distance=number_slider_7)

code_block_10 = CodeBlock { 36; }
divideCurve = Geometry.Curves.DivideCurve(translate_3, code_block_10)
number_slider_8 = DoubleSlider(35, range=0..100 step 0.1)

# group: circle6
byCenterPointRadius_5 = Circle.ByCenterPointRadius(radius=number_slider_8)

ZAxis_4 = Vector.ZAxis()
number_slider_9 = DoubleSlider(-3, range=-3..100 step 0.1)

# group: move circle6
translate_4 = Geometry.Translate(geometry=byCenterPointRadius_5, direction=ZAxis_4, distance=number_slider_9)

divideCurve_2 = Geometry.Curves.DivideCurve(translate_4, code_block_10)
byStartPointEndPoint_3 = Line.ByStartPointEndPoint(startPoint=divideCurve, endPoint=divideCurve_2)
number_slider_10 = DoubleSlider(33, range=0..100 step 0.1)

# group: circle7
byCenterPointRadius_6 = Circle.ByCenterPointRadius(radius=number_slider_10)

ZAxis_5 = Vector.ZAxis()
number_slider_11 = DoubleSlider(-1, range=-3..100 step 0.1)

# group: move circle7
translate_5 = Geometry.Translate(geometry=byCenterPointRadius_6, direction=ZAxis_5, distance=number_slider_11)

code_block_11 = CodeBlock { 72; }
divideCurve_3 = Geometry.Curves.DivideCurve(translate_5, code_block_11)
code_block_12 = CodeBlock(a=divideCurve_3) { a; }
distanceTo = Geometry.DistanceTo(geometry=divideCurve_2, other=code_block_12, lacing=CrossProduct)
code_block_13 = CodeBlock { 1; }
round = Math.Round(number=distanceTo, digits=code_block_13)
code_block_14 = CodeBlock(a=round) { a[0][1]; }
allIndicesOf = List.AllIndicesOf(list=round, item=code_block_14, lacing=Longest)
getItemAtIndex = List.GetItemAtIndex(list=code_block_12, index=allIndicesOf)
byStartPointEndPoint_4 = Line.ByStartPointEndPoint(startPoint=divideCurve_2, endPoint=getItemAtIndex)
code_block_15 = CodeBlock { 0; }
getItemAtIndex_2 = List.GetItemAtIndex(list=getItemAtIndex, index=code_block_15, lacing=Longest)
transpose = List.Transpose(pointAtParameter)
code_block_16 = CodeBlock(a=transpose) { a[0]; }
distanceTo_2 = Geometry.DistanceTo(geometry=getItemAtIndex_2, other=code_block_16, lacing=CrossProduct)
code_block_17 = CodeBlock { 2; }
round_2 = Math.Round(number=distanceTo_2, digits=code_block_17)
code_block_18 = CodeBlock { 5; }
lt = round_2 < code_block_18  # lacing=Longest
code_block_19 = CodeBlock(a=lt) { a[0]; }
code_block_20 = CodeBlock { true; }
allIndicesOf_2 = List.AllIndicesOf(list=lt, item=code_block_20, lacing=Longest)
getItemAtIndex_3 = List.GetItemAtIndex(list=code_block_16, index=allIndicesOf_2)
byStartPointEndPoint_5 = Line.ByStartPointEndPoint(startPoint=getItemAtIndex_2, endPoint=getItemAtIndex_3)
