# Dynamo graph voronoi.dyn (Dynamo 1.3.1.1736)

# group: Floors
select_model_element = DSModelElementSelection()  # 1 picked in the model

faces = Element.Faces(select_model_element)
code_block = CodeBlock(a=faces) { a[0]; }
vertices = Topology.Vertices(code_block)
pointGeometry = Vertex.PointGeometry(vertices)

# group: Columns
select_model_elements = DSModelElementsSelection()  # 9 picked in the model

location = Custom[Element.Location](element=select_model_elements)  # Returns the location of an element as an XYZ (or if it's line-based the start and end point of the line), along with some booleans to help filtering the results. Use this for some element types (e.g. walls or lines) that do not work with the built-in Get Family Instance Location node.
addItemToFront = List.AddItemToFront(item=pointGeometry, list=location.points)
flatten = Flatten(addItemToFront)
UVParameterAtPoint = Surface.UVParameterAtPoint(code_block, flatten)
byParametersOnSurface = Tessellation.Voronoi.ByParametersOnSurface(UVParameterAtPoint, code_block)
code_block_2 = CodeBlock { 20; }
randomList = Math.RandomList(code_block_2)
randomList_2 = Math.RandomList(code_block_2)
byCoordinates = UV.ByCoordinates(randomList, randomList_2)
select_model_element_2 = DSModelElementSelection()  # 1 picked in the model
elementSketch = Custom[Springs.Collector.ElementSketch](element=select_model_element_2)  # Get the actual sketch lines of a sketch based element (floor, ceiling, modified wall, etc.) . You can optionally fetch the matching model curves, however this might prove comptationally heavy on larger data sets.
code_block_3 = CodeBlock(a=elementSketch.curves) { a[0]; }
byJoinedCurves = PolyCurve.ByJoinedCurves(code_block_3)
byPatch = Surface.ByPatch(byJoinedCurves)
byParametersOnSurface_2 = Tessellation.Voronoi.ByParametersOnSurface(byCoordinates, byPatch)
code_block_4 = CodeBlock { 8; }
buildFromLines = TSpline.TSplineSurface.BuildFromLines(byParametersOnSurface_2, code_block_4)
faces_2 = Topology.Faces(buildFromLines)
edges = Topology.Edges(faces_2)
curveGeometry = Edge.CurveGeometry(edges)
byJoinedCurves_2 = PolyCurve.ByJoinedCurves(curveGeometry)
