# Dynamo graph Grid Bubble End v8.dyn (Dynamo 0.8.2.2392)

# note: Grid End 1
code_block = CodeBlock { 1; }
# note: Select Grids
select_model_elements = DSModelElementsSelection()  # 5 picked in the model
# note: Grid End 0
code_block_2 = CodeBlock { 0; }
# note: Swap Bubble Grid Ends
python_script = Python(IN[0]=select_model_elements, IN[1]=code_block_2)
# ---------- python_script.python (47 lines) ----------
#Put view on sheet
import clr
clr.AddReference('RevitAPI')
from Autodesk.Revit.DB import *

clr.AddReference("RevitNodes")
import Revit
clr.ImportExtensions(Revit.Elements)

clr.AddReference("RevitServices")
import RevitServices
from RevitServices.Persistence import DocumentManager
from RevitServices.Transactions import TransactionManager

import clr
clr.AddReference('ProtoGeometry')

from Autodesk.DesignScript.Geometry import *

doc = DocumentManager.Instance.CurrentDBDocument
#The inputs to this node will be stored as a list in the IN variables.
grids = UnwrapElement(IN[0])

a = UnwrapElement(IN[1])

if a == "0":
	b = DatumEnds.End0
else:
	b = DatumEnds.End1

	# "Start" the transaction
TransactionManager.Instance.EnsureInTransaction(doc)

view = doc.ActiveView	

for grid in grids:
	
	grid.HideBubbleInView(DatumEnds.End0, view);
	grid.HideBubbleInView(DatumEnds.End1, view);
	grid.ShowBubbleInView(b, view);

# "End" the transaction
TransactionManager.Instance.TransactionTaskDone()


#Assign your output to the OUT variable.
OUT = 0
# ----------------------------------------
class_ = Custom[Object.Class](obj=select_model_elements)  # Gets the input object's class name. Can process lists.
