# Dynamo graph GridsExtents.dyn (Dynamo 1.3.1.1736)

code_block = CodeBlock { -25000; }
code_block_2 = CodeBlock { 25000; }
python_script = Python(IN[1]=code_block, IN[2]=code_block_2)  # unwired: IN[0]
# ---------- python_script.python (30 lines) ----------
#Copyright (c) mostafa el ayoubi
#Node-mode www.data-shapes.net 2016 elayoub.mostafa@gmail.com

import clr
clr.AddReference('RevitAPI')
from Autodesk.Revit.DB import*
clr.AddReference('RevitServices')
from RevitServices.Persistence import DocumentManager
from RevitServices.Transactions import TransactionManager

doc = DocumentManager.Instance.CurrentDBDocument
UIunit = Document.GetUnits(doc).GetFormatOptions(UnitType.UT_Length).DisplayUnits

def convunit(x):
	return UnitUtils.ConvertToInternalUnits(x,UIunit)
def tolist(input):
	if isinstance(input,list):
		return UnwrapElement(input)
	else:
		return [UnwrapElement(input)]

grids = tolist(IN[0])

TransactionManager.Instance.EnsureInTransaction(doc)
for g in grids:
	#g.SetVerticalExtents(convunit(bottom),convunit(top))
	g.SetVerticalExtents(convunit(IN[1]),convunit(IN[2]))
TransactionManager.Instance.TransactionTaskDone()

OUT = grids,convunit(IN[1]),convunit(IN[2])
# ----------------------------------------
python_script_2 = Python(IN[1]=code_block, IN[2]=code_block_2)  # unwired: IN[0]
# ---------- python_script_2.python (29 lines) ----------
#Copyright (c) mostafa el ayoubi
#Node-mode www.data-shapes.net 2016 elayoub.mostafa@gmail.com

import clr
clr.AddReference('RevitAPI')
from Autodesk.Revit.DB import*
clr.AddReference('RevitServices')
from RevitServices.Persistence import DocumentManager
from RevitServices.Transactions import TransactionManager

doc = DocumentManager.Instance.CurrentDBDocument
UIunit = Document.GetUnits(doc).GetFormatOptions(UnitType.UT_Length).DisplayUnits

def convunit(x):
	return UnitUtils.ConvertToInternalUnits(x,UIunit)
def tolist(input):
	if isinstance(input,list):
		return UnwrapElement(input)
	else:
		return [UnwrapElement(input)]

grids = tolist(IN[0])

TransactionManager.Instance.EnsureInTransaction(doc)
for g,bottom,top in zip(grids,IN[1],IN[2]):
	g.SetVerticalExtents(convunit(bottom),convunit(top))
TransactionManager.Instance.TransactionTaskDone()

OUT = grids
# ----------------------------------------
select_model_element = DSModelElementSelection()  # 1 picked in the model
curves = Element.Curves(select_model_element)
endPoint = Curve.EndPoint(curves)
deconstructPoint = Geometry.Points.DeconstructPoint(endPoint)
python_script_3 = Python(IN[0]=deconstructPoint.out2)
# ---------- python_script_3.python (24 lines) ----------
#Copyright (c) mostafa el ayoubi
#Node-mode www.data-shapes.net 2016 elayoub.mostafa@gmail.com

import clr
clr.AddReference('RevitAPI')
from Autodesk.Revit.DB import*
clr.AddReference('RevitServices')
from RevitServices.Persistence import DocumentManager
from RevitServices.Transactions import TransactionManager

doc = DocumentManager.Instance.CurrentDBDocument
UIunit = Document.GetUnits(doc).GetFormatOptions(UnitType.UT_Length).DisplayUnits

def convunit(x):
	return UnitUtils.ConvertToInternalUnits(x,UIunit)
def tolist(input):
	if isinstance(input,list):
		return UnwrapElement(input)
	else:
		return [UnwrapElement(input)]



OUT = convunit(IN[0][0])
# ----------------------------------------
byLine = ReferencePlane.ByLine(curves)
select_model_elements = DSModelElementsSelection()  # 1 picked in the model
get_grid_extents = Custom[Get Grid Extents](unknownItem=select_model_elements)
intersect = Geometry.Intersect(geometry=byLine, other=get_grid_extents.outlineObjects, lacing=CrossProduct)
select_model_elements_2 = DSModelElementsSelection()
curves_2 = Element.Curves(select_model_elements_2)
elementCurveReference = Grid.ElementCurveReference(select_model_elements)
python_script_4 = Python(IN[0]=select_model_elements)
# ---------- python_script_4.python (52 lines) ----------
#python nodes in dynamo 0.7
#proposed by Julien Benoit @jbenoit44 
#http://aecuandme.wordpress.com/
import clr
clr.AddReference('ProtoGeometry')
from Autodesk.DesignScript.Geometry import *

# Import ToDSType(bool) extension method
clr.AddReference("RevitNodes")
import Revit
clr.ImportExtensions(Revit.Elements)

# Import DocumentManager and TransactionManager
clr.AddReference("RevitServices")
import RevitServices
from RevitServices.Persistence import DocumentManager
from RevitServices.Transactions import TransactionManager

from System.Collections.Generic import *

# Import RevitAPI
clr.AddReference("RevitAPI")
import Autodesk

doc = DocumentManager.Instance.CurrentDBDocument
uiapp = DocumentManager.Instance.CurrentUIApplication
app = uiapp.Application

#The inputs to this node will be stored as a list in the IN variable.
dataEnteringNode = IN

#unwrap all elements to use with API
elements = []
for i in IN[0]:
	elements.append(UnwrapElement(i))
	
# "Start" the transaction
TransactionManager.Instance.EnsureInTransaction(doc)

outlinelist = list()
for item in elements:
    try:
    	outlinelist.append(item.GetExtents())
    except:
    	outlinelist.append("No outline found")

# "End" the transaction
TransactionManager.Instance.TransactionTaskDone()


#Assign your output to the OUT variable
OUT = outlinelist
# ----------------------------------------
python_script_5 = Python(IN[0]=python_script_4)
# ---------- python_script_5.python (53 lines) ----------
#python nodes in dynamo 0.7
#proposed by Julien Benoit @jbenoit44 
#http://aecuandme.wordpress.com/
import clr
clr.AddReference('ProtoGeometry')
from Autodesk.DesignScript.Geometry import *

# Import ToDSType(bool) extension method
clr.AddReference("RevitNodes")
import Revit
clr.ImportExtensions(Revit.Elements)

# Import DocumentManager and TransactionManager
clr.AddReference("RevitServices")
import RevitServices
from RevitServices.Persistence import DocumentManager
from RevitServices.Transactions import TransactionManager

from System.Collections.Generic import *

# Import RevitAPI
clr.AddReference("RevitAPI")
import Autodesk

doc = DocumentManager.Instance.CurrentDBDocument
uiapp = DocumentManager.Instance.CurrentUIApplication
app = uiapp.Application

#The inputs to this node will be stored as a list in the IN variable.


#unwrap all elements to use with API

outlinelist = IN[0]
# "Start" the transaction
TransactionManager.Instance.EnsureInTransaction(doc)
X = list()
Y = list()
Z = list()
notfound = []
for item in outlinelist:
    try:
    	X.append(item.MinimumPoint.X)
    	Y.append(item.MinimumPoint.Y)
    	Z.append(item.MinimumPoint.Z)
    except:
    	notfound.append("Not found")

# "End" the transaction
TransactionManager.Instance.TransactionTaskDone()

#Assign your output to the OUT variable
OUT = X,Y,Z,notfound
# ----------------------------------------
convert_between_units = DynamoConvert(python_script_5, conversionMetric=Length, conversionFrom=Feet, conversionTo=Millimeters)
code_block_3 = CodeBlock(a=convert_between_units) { a[0]; a[1]; a[2]; }
byCoordinates = Point.ByCoordinates(x=code_block_3.out0, y=code_block_3.out1, z=code_block_3.out2)
python_script_6 = Python(IN[0]=python_script_4)
# ---------- python_script_6.python (53 lines) ----------
#python nodes in dynamo 0.7
#proposed by Julien Benoit @jbenoit44 
#http://aecuandme.wordpress.com/
import clr
clr.AddReference('ProtoGeometry')
from Autodesk.DesignScript.Geometry import *

# Import ToDSType(bool) extension method
clr.AddReference("RevitNodes")
import Revit
clr.ImportExtensions(Revit.Elements)

# Import DocumentManager and TransactionManager
clr.AddReference("RevitServices")
import RevitServices
from RevitServices.Persistence import DocumentManager
from RevitServices.Transactions import TransactionManager

from System.Collections.Generic import *

# Import RevitAPI
clr.AddReference("RevitAPI")
import Autodesk

doc = DocumentManager.Instance.CurrentDBDocument
uiapp = DocumentManager.Instance.CurrentUIApplication
app = uiapp.Application

#The inputs to this node will be stored as a list in the IN variable.


#unwrap all elements to use with API

outlinelist = IN[0]
# "Start" the transaction
TransactionManager.Instance.EnsureInTransaction(doc)
X = list()
Y = list()
Z = list()
notfound = []
for item in outlinelist:
    try:
    	X.append(item.MaximumPoint.X)
    	Y.append(item.MaximumPoint.Y)
    	Z.append(item.MaximumPoint.Z)
    except:
    	notfound.append("Not found")

# "End" the transaction
TransactionManager.Instance.TransactionTaskDone()

#Assign your output to the OUT variable
OUT = X,Y,Z,notfound
# ----------------------------------------
convert_between_units_2 = DynamoConvert(python_script_6, conversionMetric=Length, conversionFrom=Feet, conversionTo=Millimeters)
code_block_4 = CodeBlock(a=convert_between_units_2) { a[0]; a[1]; a[2]; }
byCoordinates_2 = Point.ByCoordinates(x=code_block_4.out0, y=code_block_4.out1, z=code_block_4.out2)
byCorners = BoundingBox.ByCorners(min=byCoordinates, max=byCoordinates_2)
byGeometry = BoundingBox.ByGeometry(curves)
select_model_elements_3 = DSModelElementsSelection()  # 1 picked in the model
curve = Grid.Curve(select_model_elements_3)
boundingBox = Geometry.BoundingBox(curve)
intersection = BoundingBox.Intersection(byGeometry, boundingBox)
length = Curve.Length(curve)
pick_model_element = Custom[Pick Model Element]()  # This offers a single selection of a model element. Created for Dynamo Player usage.
curves_3 = Element.Curves(pick_model_element)
length_2 = Curve.Length(curves_3)
