# Dynamo graph SetGridExtents22.dyn (Dynamo 2.12.1.8246)

# group: ANNOTATION
# note: USE:
# FOR COMMENTS AND IMPORTANT INFO
# note: ANNOTATION

# group: CONTROL
# note: USE:
# FOR VARIABLE CONTROL INPUTS
# SUCH AS SLIDERS
# note: CONTROL

# group: MONITOR
# note: USE:
# FOR IMPORTANT WATCH NODES
# note: MONITOR

# group: INPUT
# note: USE:
# FOR FIXED INPUTS SUCH AS FILE PATHS
# note: INPUT

# group: TO REVIT
# note: USE:
# FOR NODE BLOCKS THAT EXPORTS GEOMETRY
# AND PARAMETERS TO REVIT
# note: TO REVIT

# group: Shortest Path
# note: DYNAMO VERSION: DYNAMO 1.3
# PACKAGES REQUIRED TO RUN:
# - SPRING NODES
# - LUNCHBOX

# group: Select Grids to modify
select_model_elements = DSModelElementsSelection()  # 3 picked in the model; graph input

current = Document.Current()
activeView = Document.ActiveView(document=current)

# group: Select Alignment Lines
run = BoolSelector(true)  # graph input

python_script = Python(IN[0]=run)  # IronPython2
# ---------- python_script.python (42 lines) ----------
# Load the Python Standard and DesignScript Libraries
import sys
import clr
clr.AddReference('ProtoGeometry')
clr.AddReference('RevitAPI')
clr.AddReference('RevitAPIUI')
from Autodesk.Revit.UI.Selection import *

clr.AddReference('RevitServices')
import RevitServices
from RevitServices.Persistence import DocumentManager

# The inputs to this node will be stored as a list in the IN variables.
run = IN[0]


#https://dynamopythonprimer.gitbook.io/dynamo-python-primer/4-revit-specific-topics/prompting-ui-selection
#You'll also want to import the below namespace to get access
#to the ISelectionFilter interface
class MySelectionFilter(ISelectionFilter):
	def __init__(self):
		pass
	def AllowElement(self, element):
		if element.Category.Name == "Walls":
			return True
		else:
			return False
	def AllowReference(self, element):
		return False

selection_filter = MySelectionFilter()

doc = DocumentManager.Instance.CurrentDBDocument
uidoc=DocumentManager.Instance.CurrentUIApplication.ActiveUIDocument

selection = None

if run:
	selection = uidoc.Selection.PickObjects(ObjectType.Element)
	OUT = [doc.GetElement(r) for r in selection]
else:
	OUT = 'Set Run to true'
# ----------------------------------------
geometry = Element.Geometry(element=python_script)
curve = Grid.Curve(grid=select_model_elements)
code_block = CodeBlock(curve=curve) { curve[0]; }
startPoint = Curve.StartPoint(curve=code_block)
byOriginNormal = Plane.ByOriginNormal(origin=startPoint)
pullOntoPlane = Curve.PullOntoPlane(curve=geometry@L1, plane=byOriginNormal, lacing=Longest)
intersectAll = Geometry.IntersectAll(geometry=pullOntoPlane@L1, others=curve, lacing=CrossProduct)
flatten = List.Flatten(list=intersectAll@L3)
transpose = List.Transpose(lists=flatten)
deconstruct = List.Deconstruct(list=transpose@L2)
byStartPointEndPoint = Line.ByStartPointEndPoint(startPoint=deconstruct.first, endPoint=deconstruct.rest)
flatten_2 = List.Flatten(list=byStartPointEndPoint)
code_block_2 = CodeBlock { Vector.ZAxis(); }
python_script_2 = Python(IN[0]=select_model_elements, IN[1]=activeView)  # IronPython2
# ---------- python_script_2.python (43 lines) ----------
import clr
clr.AddReference('ProtoGeometry')
from Autodesk.DesignScript.Geometry import *

# Import DocumentManager and TransactionManager
clr.AddReference("RevitServices")
import RevitServices
from RevitServices.Persistence import DocumentManager
from RevitServices.Transactions import TransactionManager

# Import RevitAPI
clr.AddReference("RevitAPI")
import Autodesk
from Autodesk.Revit.DB import *

clr.AddReference("RevitNodes")
import Revit
clr.ImportExtensions(Revit.GeometryConversion)


doc = DocumentManager.Instance.CurrentDBDocument
uiapp = DocumentManager.Instance.CurrentUIApplication
app = uiapp.Application


grids = UnwrapElement(IN[0])
view = UnwrapElement(IN[1])

gridCurves = []
curves = []


for g in grids:
	gridCurves.append(g.GetCurvesInView(DatumExtentType.Model, view))

for i in range(0,len(gridCurves)):
	for c in gridCurves[i]:
		start = c.GetEndPoint(0)
		end = c.GetEndPoint(1)
		curves.append(Line.CreateBound(start,end).ToProtoType())

#Assign your outputs to the OUT variable
OUT = curves
# ----------------------------------------
startPoint_2 = Curve.StartPoint(curve=python_script_2)
code_block_3 = CodeBlock(a=startPoint_2) { a[0].Z; }
translate = Geometry.Translate(geometry=flatten_2, direction=code_block_2, distance=code_block_3)
flatten_3 = List.Flatten(list=translate)
endPoint = Curve.EndPoint(curve=flatten_3)
startPoint_3 = Curve.StartPoint(curve=flatten_3)

# group: Invert start and end point to change head position
python_script_3 = Python(IN[0]=endPoint, IN[1]=startPoint_3)  # IronPython2
# ---------- python_script_3.python (36 lines) ----------
import clr
clr.AddReference('ProtoGeometry')
from Autodesk.DesignScript.Geometry import *

# Import DocumentManager and TransactionManager
clr.AddReference("RevitServices")
import RevitServices
from RevitServices.Persistence import DocumentManager
from RevitServices.Transactions import TransactionManager

# Import RevitAPI
clr.AddReference("RevitAPI")
import Autodesk
from Autodesk.Revit.DB import *

clr.AddReference("RevitNodes")
import Revit
clr.ImportExtensions(Revit.GeometryConversion)


doc = DocumentManager.Instance.CurrentDBDocument
uiapp = DocumentManager.Instance.CurrentUIApplication
app = uiapp.Application


startPts = UnwrapElement(IN[0])
endPts = UnwrapElement(IN[1])
revitCurves = []

  
for i in range(0,len(startPts)):
	newLine = Line.CreateBound(startPts[i].ToXyz(),endPts[i].ToXyz())
	revitCurves.append(newLine)
    
#Assign your outputs to the OUT variable
OUT = revitCurves
# ----------------------------------------

# group: Set GridLines
python_script_4 = Python(IN[0]=select_model_elements, IN[1]=activeView, IN[2]=python_script_3)  # IronPython2
# ---------- python_script_4.python (44 lines) ----------
import clr
clr.AddReference('ProtoGeometry')
from Autodesk.DesignScript.Geometry import *

# Import DocumentManager and TransactionManager
clr.AddReference("RevitServices")
import RevitServices
from RevitServices.Persistence import DocumentManager
from RevitServices.Transactions import TransactionManager

# Import RevitAPI
clr.AddReference("RevitAPI")
import Autodesk
from Autodesk.Revit.DB import *

clr.AddReference("RevitNodes")
import Revit
clr.ImportExtensions(Revit.GeometryConversion)


doc = DocumentManager.Instance.CurrentDBDocument
uiapp = DocumentManager.Instance.CurrentUIApplication
app = uiapp.Application


grids = UnwrapElement(IN[0])
view = UnwrapElement(IN[1])
crvs = UnwrapElement(IN[2])

curves = []
curvesViews = []

TransactionManager.Instance.EnsureInTransaction(doc)

for i in range(0,len(grids)):	
	grids[i].SetCurveInView(DatumExtentType.ViewSpecific,view,crvs[i])


TransactionManager.Instance.TransactionTaskDone()
	

	
#Assign your outputs to the OUT variable
OUT = grids
# ----------------------------------------

endPoint_2 = Curve.EndPoint(curve=python_script_2)
