# Dynamo graph SetGridExtentsMultipleViews2024.dyn (Dynamo 2.18.1.5096)

# group: ANNOTATION
# note: USE:
# FOR COMMENTS AND IMPORTANT INFO
# note: ANNOTATION

# group: CONTROL
# note: USE:
# FOR VARIABLE CONTROL INPUTS
# SUCH AS SLIDERS
# note: CONTROL

# group: MONITOR
# note: USE:
# FOR IMPORTANT WATCH NODES
# note: MONITOR

# group: INPUT
# note: USE:
# FOR FIXED INPUTS SUCH AS FILE PATHS
# note: INPUT

# group: TO REVIT
# note: USE:
# FOR NODE BLOCKS THAT EXPORTS GEOMETRY
# AND PARAMETERS TO REVIT
# note: TO REVIT

# group: Shortest Path
# note: DYNAMO VERSION: DYNAMO 1.3
# PACKAGES REQUIRED TO RUN:
# - SPRING NODES
# - LUNCHBOX

# group: Select Grids to modify
select_model_elements = DSModelElementsSelection()  # 6 picked in the model

views = Views("R2")
views_2 = Views("R2")
code_block = CodeBlock(a=views, b=views_2) { [a,b]; }

# group: Select Alignment Lines
run = BoolSelector(true)  # graph input

python_script = Python(IN[0]=run)  # CPython3
# ---------- python_script.python (28 lines) ----------
# Load the Python Standard and DesignScript Libraries
import sys
import clr
clr.AddReference('ProtoGeometry')
clr.AddReference('RevitAPI')
clr.AddReference('RevitAPIUI')
from Autodesk.Revit.UI.Selection import ISelectionFilter, ObjectType


clr.AddReference('RevitServices')
import RevitServices
from RevitServices.Persistence import DocumentManager

# The inputs to this node will be stored as a list in the IN variables.
run = IN[0]
        
        
doc = DocumentManager.Instance.CurrentDBDocument
uidoc=DocumentManager.Instance.CurrentUIApplication.ActiveUIDocument

selection = None


if run:
	selection = uidoc.Selection.PickObjects(ObjectType.Element, "Select Lines")
	OUT = [doc.GetElement(r) for r in selection]
else:
	OUT = 'Set Run to true'
# ----------------------------------------
geometry = Element.Geometry(element=python_script)
curve = Grid.Curve(grid=select_model_elements)
code_block_2 = CodeBlock(curve=curve) { curve[0]; }
startPoint = Curve.StartPoint(curve=code_block_2)
byOriginNormal = Plane.ByOriginNormal(origin=startPoint)
pullOntoPlane = Curve.PullOntoPlane(curve=geometry@L1, plane=byOriginNormal, lacing=Longest)
intersectAll = Geometry.IntersectAll(geometry=pullOntoPlane@L1, others=curve, lacing=CrossProduct)
flatten = List.Flatten(list=intersectAll@L3)
transpose = List.Transpose(lists=flatten)
deconstruct = List.Deconstruct(list=transpose@L2)
byStartPointEndPoint = Line.ByStartPointEndPoint(startPoint=deconstruct.first, endPoint=deconstruct.rest)
flatten_2 = List.Flatten(list=byStartPointEndPoint)
code_block_3 = CodeBlock { Vector.ZAxis(); }
current = Document.Current()
activeView = Document.ActiveView(document=current)
python_script_2 = Python(IN[0]=select_model_elements, IN[1]=activeView)  # CPython3
# ---------- python_script_2.python (43 lines) ----------
import clr
clr.AddReference('ProtoGeometry')
from Autodesk.DesignScript.Geometry import *

# Import DocumentManager and TransactionManager
clr.AddReference("RevitServices")
import RevitServices
from RevitServices.Persistence import DocumentManager
from RevitServices.Transactions import TransactionManager

# Import RevitAPI
clr.AddReference("RevitAPI")
import Autodesk
from Autodesk.Revit.DB import *

clr.AddReference("RevitNodes")
import Revit
clr.ImportExtensions(Revit.GeometryConversion)


doc = DocumentManager.Instance.CurrentDBDocument
uiapp = DocumentManager.Instance.CurrentUIApplication
app = uiapp.Application


grids = UnwrapElement(IN[0])
view = UnwrapElement(IN[1])

gridCurves = []
curves = []


for g in grids:
	gridCurves.append(g.GetCurvesInView(DatumExtentType.Model, view))

for i in range(0,len(gridCurves)):
	for c in gridCurves[i]:
		start = c.GetEndPoint(0)
		end = c.GetEndPoint(1)
		curves.append(Line.CreateBound(start,end).ToProtoType())

#Assign your outputs to the OUT variable
OUT = curves
# ----------------------------------------
startPoint_2 = Curve.StartPoint(curve=python_script_2)
code_block_4 = CodeBlock(a=startPoint_2) { a[0].Z; }
translate = Geometry.Translate(geometry=flatten_2, direction=code_block_3, distance=code_block_4)
flatten_3 = List.Flatten(list=translate)
startPoint_3 = Curve.StartPoint(curve=flatten_3)
endPoint = Curve.EndPoint(curve=flatten_3)

# group: Invert start and end point to change head position
python_script_3 = Python(IN[0]=startPoint_3, IN[1]=endPoint)  # CPython3
# ---------- python_script_3.python (36 lines) ----------
import clr
clr.AddReference('ProtoGeometry')
from Autodesk.DesignScript.Geometry import *

# Import DocumentManager and TransactionManager
clr.AddReference("RevitServices")
import RevitServices
from RevitServices.Persistence import DocumentManager
from RevitServices.Transactions import TransactionManager

# Import RevitAPI
clr.AddReference("RevitAPI")
import Autodesk
from Autodesk.Revit.DB import *

clr.AddReference("RevitNodes")
import Revit
clr.ImportExtensions(Revit.GeometryConversion)


doc = DocumentManager.Instance.CurrentDBDocument
uiapp = DocumentManager.Instance.CurrentUIApplication
app = uiapp.Application


startPts = UnwrapElement(IN[0])
endPts = UnwrapElement(IN[1])
revitCurves = []

  
for i in range(0,len(startPts)):
	newLine = Line.CreateBound(startPts[i].ToXyz(),endPts[i].ToXyz())
	revitCurves.append(newLine)
    
#Assign your outputs to the OUT variable
OUT = revitCurves
# ----------------------------------------

# group: Set GridLines
python_script_4 = Python(IN[0]=select_model_elements, IN[1]=code_block, IN[2]=python_script_3)  # CPython3
# ---------- python_script_4.python (54 lines) ----------
import clr
clr.AddReference('ProtoGeometry')
from Autodesk.DesignScript.Geometry import *

# Import DocumentManager and TransactionManager
clr.AddReference("RevitServices")
import RevitServices
from RevitServices.Persistence import DocumentManager
from RevitServices.Transactions import TransactionManager

# Import RevitAPI
clr.AddReference("RevitAPI")
import Autodesk
from Autodesk.Revit.DB import *

clr.AddReference("RevitNodes")
import Revit
clr.ImportExtensions(Revit.GeometryConversion)


doc = DocumentManager.Instance.CurrentDBDocument
uiapp = DocumentManager.Instance.CurrentUIApplication
app = uiapp.Application


grids = UnwrapElement(IN[0])
view = UnwrapElement(IN[1])
crvs = UnwrapElement(IN[2])

curves = []
curvesViews = []


TransactionManager.Instance.EnsureInTransaction(doc)

for i in range(0,len(grids)):	
    for v in view:
        levelZ = grids[i].GetCurvesInView(DatumExtentType.Model, v)[0].Origin.Z
        curveZ = crvs[i].Origin.Z
        moveZ = XYZ(0, 0, levelZ-curveZ);
        tf = Transform.CreateTranslation(moveZ)
        newc = crvs[i].CreateTransformed(tf)
        grids[i].SetCurveInView(DatumExtentType.ViewSpecific,v,newc)


TransactionManager.Instance.TransactionTaskDone()

 




#Assign your outputs to the OUT variable
OUT = grids
# ----------------------------------------
