# Dynamo graph gridLevelIntersect.dyn (Dynamo 1.3.1.1736)

# group: CREATE A PLANE FOR THE SELECTED VIEW
views = Views("Section 1")
code_block = CodeBlock(a=views) { {a}; }
python_script = Python(IN[0]=code_block)
# ---------- python_script.python (20 lines) ----------
import clr
clr.AddReference('RevitAPI')
from Autodesk.Revit.DB import *

clr.AddReference("RevitNodes")
import Revit
clr.ImportExtensions(Revit.GeometryConversion)

items = UnwrapElement(IN[0])
dlist = list()

origin = []

for item in items:
	try:
		dlist.append(item.ViewDirection.ToVector())
		origin.append(item.Origin.ToPoint())
	except:
		dlist.append(None)
OUT = dlist, origin
# ----------------------------------------
code_block_2 = CodeBlock(a=python_script) { a[1]; }
code_block_3 = CodeBlock(a=python_script) { a[0]; }
byOriginNormal = Plane.ByOriginNormal(origin=code_block_2, normal=code_block_3)

# group: GET THE GRIDS NAMES AND UNDERLYING CURVES
select_model_elements = DSModelElementsSelection()  # 10 picked in the model
curve = Grid.Curve(select_model_elements)
name = Element.Name(select_model_elements)

# group: FIND THE INTERSECTION POINTS
intersect = Geometry.Intersect(geometry=byOriginNormal, other=curve, lacing=Longest)
flatten = Flatten(intersect)

# group: GET LEVELS NAMES AND CREATE LEVEL PLANES
select_model_elements_2 = DSModelElementsSelection()  # 5 picked in the model
elevation = Level.Elevation(select_model_elements_2)
code_block_4 = CodeBlock(z=elevation) { Autodesk.Point.ByCoordinates(0,0,z); }
ZAxis = Vector.ZAxis()
byOriginNormal_2 = Plane.ByOriginNormal(origin=code_block_4, normal=ZAxis)
name_2 = Element.Name(select_model_elements_2)

# group: PROJECT THE GRIDS-VIEW INTERSECTION POINTS TO EACH LEVEL
ZAxis_2 = Vector.ZAxis()
project = Point.Project(flatten, byOriginNormal_2, ZAxis_2, lacing=CrossProduct)
flatten_2 = Flatten(project@L4)

# group: PLACE THE GENERIC ANNOTATION FAMILY AT EACH POINT (CLOCKWORK)
family_types = FamilyTypes("Family1:Family1")
# note: Freeze and Unfreeze this node to update the Active View output
get_revit_activeview = Custom[Get Revit ActiveView]()  # Active View
byPointInView = Custom[FamilyInstance.ByPointInView](point=flatten_2, familyType=family_types, view=get_revit_activeview)  # Places a family instance at a given point in a given view (e.g. a detail component).

# group: CREATE AN IDENTITY TAG
code_block_5 = CodeBlock(name_2, name) { b<1L>+"_"+a<1L>; }

# group: ASSIGN THE IDENTITY TAG TO EACH FAMILY
code_block_6 = CodeBlock { "PlateTag"; }
setParameterByName = Element.SetParameterByName(element=byPointInView, parameterName=code_block_6, value=code_block_5)

# group: CLOCKWORK PYTHON CODE
python_script_2 = Python()  # unwired: IN[0], IN[1], IN[2]
# ---------- python_script_2.python (33 lines) ----------
"""
import clr
clr.AddReference('RevitAPI')
from Autodesk.Revit.DB import *

clr.AddReference("RevitNodes")
import Revit
clr.ImportExtensions(Revit.Elements)
clr.ImportExtensions(Revit.GeometryConversion)

clr.AddReference("RevitServices")
import RevitServices
from RevitServices.Persistence import DocumentManager
from RevitServices.Transactions import TransactionManager

doc = DocumentManager.Instance.CurrentDBDocument
points = UnwrapElement(IN[0])
famtype = UnwrapElement(IN[1])
lvl = UnwrapElement(IN[2])
elementlist = list()
counter = 0

TransactionManager.Instance.EnsureInTransaction(doc)
# make sure familysymbol is active
if famtype.IsActive == False:
	famtype.Activate()
	doc.Regenerate()
for point in points:
	newobj = doc.Create.NewFamilyInstance(point.ToXyz(),famtype,lvl)
	elementlist.append(newobj.ToDSType(False))
TransactionManager.Instance.TransactionTaskDone()
OUT = elementlist
"""
# ----------------------------------------
