# Dynamo graph Hatch Area.dyn (Dynamo 0.8.2.2392)

code_block = CodeBlock { "Mark"; }
select_model_elements = DSModelElementsSelection()  # 30 picked in the model
element_type_for_element_lists = Custom[Element Type for Element Lists](Element_s=select_model_elements)
flatten = Flatten(element_type_for_element_lists)
name = FamilySymbol.Name()
sortByKey = SortByKey(flatten, name)
allIndicesOf = List.AllIndicesOf(list=element_type_for_element_lists, item=sortByKey)
uniqueItems = List.UniqueItems(allIndicesOf)
getItemAtIndex = List.GetItemAtIndex(list=select_model_elements, index=uniqueItems)
code_block_2 = CodeBlock { "Area"; }
getParameterValueByName = Element.GetParameterValueByName(element=getItemAtIndex, parameterName=code_block_2)
code_block_3 = CodeBlock(a=getParameterValueByName) { Math.Ceiling(a); }
string_from_object = FromObject(code_block_3)
setParameterByName = Element.SetParameterByName(parameterName=code_block, value=string_from_object)
watch = Watch(select_model_elements)
name_2 = FamilySymbol.Name(sortByKey)
uniqueItems_2 = List.UniqueItems(name_2)
sum = Math.Sum(code_block_3)
watch_2 = Custom[Watch+](input=sum)  # This node that serializes the input information and presents it in a resizable text window.
