# Dynamo graph Intersect.dyn (Dynamo 1.2.3.592)

select_model_element = DSModelElementSelection()  # 1 picked in the model
code_block = CodeBlock { "Layer 01"; }
curvesFromCADLayers = Custom[CurvesFromCADLayers](importInstance=select_model_element, layerNames=code_block)  # Extract curves from a CAD link or import by layer name. Curves are organised into layer sublists. To create Revit Model Lines set the createModelLines input to true This node is also optimised to convert curve types that typically fail when using Revit.Elements.Element.Curves or Full Explode
watch = Watch(curvesFromCADLayers.curves)
flatten = Flatten(watch)
code_block_2 = CodeBlock { "Layer 02"; }
curvesFromCADLayers_2 = Custom[CurvesFromCADLayers](importInstance=select_model_element, layerNames=code_block_2)
watch_2 = Watch(curvesFromCADLayers_2.curves)
flatten_2 = Flatten(watch_2)
intersect = Geometry.Intersect(geometry=flatten, other=flatten_2, lacing=Longest)
