# Dynamo graph Multiple Join Only Clashing v08.dyn (Dynamo 0.8.2.2392)

py_join = Python()
# ---------- py_join.python (32 lines) ----------
import clr
clr.AddReference('RevitAPI')
from Autodesk.Revit.DB import *
from System.Collections.Generic import *
clr.AddReference("RevitServices")
import RevitServices
from RevitServices.Persistence import DocumentManager
from RevitServices.Transactions import TransactionManager

doc = DocumentManager.Instance.CurrentDBDocument

#The inputs to this node will be stored as a list in the IN variables.
dataEnteringNode = IN

items1 = UnwrapElement(IN[0])


TransactionManager.Instance.EnsureInTransaction(doc)
booleans=[]

for i in range (0,len(items1)):
	for j in range(0,len(items1[i])):
		try:
			JoinGeometryUtils.JoinGeometry(doc,items1[i][0],items1[i][j])
			booleans.append(True)
		except:
			booleans.append(False)

TransactionManager.Instance.TransactionTaskDone()

#Assign your output to the OUT variable.
OUT = booleans
# ----------------------------------------
# note: Select Element to be Joined
select_model_elements = DSModelElementsSelection()  # 4 picked in the model
# note: Select Element to be Joined to
select_model_elements_2 = DSModelElementsSelection()  # 1 picked in the model
code_block = CodeBlock { 1; }
getSurroundingElements = Custom[Tool.GetSurroundingElements](Element_s=select_model_elements, Element_s_to_check=select_model_elements_2, Tolerance=code_block)  # Get Surrounding Elements by Categories, group them as List. Tolerance distance available.
count = List.Count()
map = List.Map(list=getSurroundingElements, f_x=count)
code_block_2 = CodeBlock { 1; }
gt = map > code_block_2
filterByBoolMask = List.FilterByBoolMask(list=getSurroundingElements, mask=gt)
py_switch_join = Python(IN[0]=filterByBoolMask.in)
# ---------- py_switch_join.python (32 lines) ----------
import clr
clr.AddReference('RevitAPI')
from Autodesk.Revit.DB import *
from System.Collections.Generic import *
clr.AddReference("RevitServices")
import RevitServices
from RevitServices.Persistence import DocumentManager
from RevitServices.Transactions import TransactionManager

doc = DocumentManager.Instance.CurrentDBDocument

#The inputs to this node will be stored as a list in the IN variables.
dataEnteringNode = IN

items1 = UnwrapElement(IN[0])


TransactionManager.Instance.EnsureInTransaction(doc)
booleans=[]

for i in range (0,len(items1)):
	for j in range(0,len(items1[i])):
		try:
			JoinGeometryUtils.SwitchJoinOrder(doc,items1[i][0],items1[i][j])
			booleans.append(True)
		except:
			booleans.append(False)

TransactionManager.Instance.TransactionTaskDone()

#Assign your output to the OUT variable.
OUT = booleans
# ----------------------------------------
