# Dynamo graph Multiple Join Only Clashing.dyn (Dynamo 1.2.0.2514)

# group: JOIN Based on Clockwork Element.JoinGeometry
python_script = Python()  # unwired: IN[0]
# ---------- python_script.python (32 lines) ----------
import clr
clr.AddReference('RevitAPI')
from Autodesk.Revit.DB import *
from System.Collections.Generic import *
clr.AddReference("RevitServices")
import RevitServices
from RevitServices.Persistence import DocumentManager
from RevitServices.Transactions import TransactionManager

doc = DocumentManager.Instance.CurrentDBDocument

#The inputs to this node will be stored as a list in the IN variables.
dataEnteringNode = IN

items1 = UnwrapElement(IN[0])


TransactionManager.Instance.EnsureInTransaction(doc)
booleans=[]

for i in range (0,len(items1)):
	for j in range(0,len(items1[i])):
		try:
			JoinGeometryUtils.JoinGeometry(doc,items1[i][0],items1[i][j])
			booleans.append(True)
		except:
			booleans.append(False)

TransactionManager.Instance.TransactionTaskDone()

#Assign your output to the OUT variable.
OUT = booleans
# ----------------------------------------

# group: UNJOIN Based on Clockwork Element.JoinGeometry
python_script_2 = Python()  # unwired: IN[0]
# ---------- python_script_2.python (32 lines) ----------
import clr
clr.AddReference('RevitAPI')
from Autodesk.Revit.DB import *
from System.Collections.Generic import *
clr.AddReference("RevitServices")
import RevitServices
from RevitServices.Persistence import DocumentManager
from RevitServices.Transactions import TransactionManager

doc = DocumentManager.Instance.CurrentDBDocument

#The inputs to this node will be stored as a list in the IN variables.
dataEnteringNode = IN

items1 = UnwrapElement(IN[0])


TransactionManager.Instance.EnsureInTransaction(doc)
booleans=[]

for i in range (0,len(items1)):
	for j in range(0,len(items1[i])):
		try:
			JoinGeometryUtils.UnjoinGeometry(doc,items1[i][0],items1[i][j])
			booleans.append(True)
		except:
			booleans.append(False)

TransactionManager.Instance.TransactionTaskDone()

#Assign your output to the OUT variable.
OUT = booleans
# ----------------------------------------

# group: SWITCH JOIN ORDER Based on Clockwork Element.JoinGeometry
python_script_3 = Python()  # unwired: IN[0]
# ---------- python_script_3.python (32 lines) ----------
import clr
clr.AddReference('RevitAPI')
from Autodesk.Revit.DB import *
from System.Collections.Generic import *
clr.AddReference("RevitServices")
import RevitServices
from RevitServices.Persistence import DocumentManager
from RevitServices.Transactions import TransactionManager

doc = DocumentManager.Instance.CurrentDBDocument

#The inputs to this node will be stored as a list in the IN variables.
dataEnteringNode = IN

items1 = UnwrapElement(IN[0])


TransactionManager.Instance.EnsureInTransaction(doc)
booleans=[]

for i in range (0,len(items1)):
	for j in range(0,len(items1[i])):
		try:
			JoinGeometryUtils.SwitchJoinOrder(doc,items1[i][0],items1[i][j])
			booleans.append(True)
		except:
			booleans.append(False)

TransactionManager.Instance.TransactionTaskDone()

#Assign your output to the OUT variable.
OUT = booleans
# ----------------------------------------

# note: Select Element to be Joined
select_model_elements = DSModelElementsSelection()  # 4 picked in the model
getJoinedElements = Custom[Element.GetJoinedElements](element=select_model_elements)  # This will obtain the elements joined to the input element.
select_model_element = DSModelElementSelection()

# group: GetJoinedElements Based on Clockwork Element.JoinGeometry
python_script_4 = Python(IN[0]=select_model_elements)
# ---------- python_script_4.python (32 lines) ----------
import clr
clr.AddReference('RevitAPI')
from Autodesk.Revit.DB import *
from System.Collections.Generic import *
clr.AddReference("RevitServices")
import RevitServices
from RevitServices.Persistence import DocumentManager
from RevitServices.Transactions import TransactionManager

doc = DocumentManager.Instance.CurrentDBDocument

#The inputs to this node will be stored as a list in the IN variables.
dataEnteringNode = IN

items1 = UnwrapElement(IN[0])


TransactionManager.Instance.EnsureInTransaction(doc)
booleans=[]
joinedlist=[]

for i in range (0,len(items1)):
	try:
		joinedlist.append(JoinGeometryUtils.GetJoinedElements(doc,items1[i]))
		booleans.append(True)
	except:
		booleans.append(False)

TransactionManager.Instance.TransactionTaskDone()

#Assign your output to the OUT variable.
OUT = joinedlist
# ----------------------------------------

# group: ARE ELEMENT JOINED?
python_script_5 = Python(IN[0]=python_script_4)
# ---------- python_script_5.python (30 lines) ----------
import clr
clr.AddReference('RevitAPI')
from Autodesk.Revit.DB import *
from System.Collections.Generic import *
clr.AddReference("RevitServices")
import RevitServices
from RevitServices.Persistence import DocumentManager
from RevitServices.Transactions import TransactionManager

doc = DocumentManager.Instance.CurrentDBDocument

#The inputs to this node will be stored as a list in the IN variables.
dataEnteringNode = IN

items1 = UnwrapElement(IN[0])


TransactionManager.Instance.EnsureInTransaction(doc)
booleans=[]

for i in range (0,len(items1)):
	if len(items1[i]) == 0:
		booleans.append(False)
	else:
		booleans.append(True)

TransactionManager.Instance.TransactionTaskDone()

#Assign your output to the OUT variable.
OUT = booleans
# ----------------------------------------

filterByBoolMask = List.FilterByBoolMask(list=select_model_elements, mask=python_script_5)
watch = Watch(filterByBoolMask.in)
watch_2 = Watch(filterByBoolMask.out)
# note: Select Element to be Joined to
select_model_elements_2 = DSModelElementsSelection()  # 3 picked in the model
code_block = CodeBlock { 1; }

# group: SteamNodes
getSurroundingElements = Custom[Tool.GetSurroundingElements](Element=select_model_elements, ElementCheck=select_model_elements_2, Tolerance=code_block)  # Get Surrounding Elements by Categories, group them as List. Tolerance distance available.

count = List.Count()  # unwired: arg0
map = List.Map(list=getSurroundingElements, f_x=count)
code_block_2 = CodeBlock { 1; }
gt = map > code_block_2
filterByBoolMask_2 = List.FilterByBoolMask(list=getSurroundingElements, mask=gt)
watch_3 = Watch(filterByBoolMask_2.in)

# group: JOIN+SWITCH JOIN Based on Clockwork Element.JoinGeometry
python_script_6 = Python(IN[0]=watch_3)
# ---------- python_script_6.python (34 lines) ----------
import clr
clr.AddReference('RevitAPI')
from Autodesk.Revit.DB import *
from System.Collections.Generic import *
clr.AddReference("RevitServices")
import RevitServices
from RevitServices.Persistence import DocumentManager
from RevitServices.Transactions import TransactionManager

doc = DocumentManager.Instance.CurrentDBDocument

#The inputs to this node will be stored as a list in the IN variables.
dataEnteringNode = IN

items1 = UnwrapElement(IN[0])


TransactionManager.Instance.EnsureInTransaction(doc)
booleans=[]

for i in range (0,len(items1)):
	for j in range(0,len(items1[i])):
		try:
			JoinGeometryUtils.JoinGeometry(doc,items1[i][0],items1[i][j])
			JoinGeometryUtils.SwitchJoinOrder(doc,items1[i][0],items1[i][j])
			booleans.append(True)
		except:
			booleans.append(False)


TransactionManager.Instance.TransactionTaskDone()

#Assign your output to the OUT variable.
OUT = booleans
# ----------------------------------------
