# Dynamo graph Multiple Join.dyn (Dynamo 1.0.0.1180)

# note: Select Multiple Walls
select_model_elements = DSModelElementsSelection()
# note: Select One Floor
select_model_element = DSModelElementSelection()
python_script = Python(IN[0]=select_model_elements, IN[1]=select_model_element)
# ---------- python_script.python (30 lines) ----------
import clr
clr.AddReference('RevitAPI')
from Autodesk.Revit.DB import *
from System.Collections.Generic import *
clr.AddReference("RevitServices")
import RevitServices
from RevitServices.Persistence import DocumentManager
from RevitServices.Transactions import TransactionManager

doc = DocumentManager.Instance.CurrentDBDocument

#The inputs to this node will be stored as a list in the IN variables.
dataEnteringNode = IN

items1 = UnwrapElement(IN[0])
items2 = UnwrapElement(IN[1])
i = 0
booleans=[]
TransactionManager.Instance.EnsureInTransaction(doc)
for item1 in items1:
	try:
		JoinGeometryUtils.JoinGeometry(doc,item1,items2)
		booleans.append(True)
	except:
		booleans.append(False)
	i += 1
TransactionManager.Instance.TransactionTaskDone()

#Assign your output to the OUT variable.
OUT = booleans
# ----------------------------------------
python_script_2 = Python()
# ---------- python_script_2.python (30 lines) ----------
import clr
clr.AddReference('RevitAPI')
from Autodesk.Revit.DB import *
from System.Collections.Generic import *
clr.AddReference("RevitServices")
import RevitServices
from RevitServices.Persistence import DocumentManager
from RevitServices.Transactions import TransactionManager

doc = DocumentManager.Instance.CurrentDBDocument

#The inputs to this node will be stored as a list in the IN variables.
dataEnteringNode = IN

items1 = UnwrapElement(IN[0])
items2 = UnwrapElement(IN[1])
booleans=[]
TransactionManager.Instance.EnsureInTransaction(doc)
for item1 in items1:
	for item2 in items2:
		if item1.DoesIntersect(item2):
			try:
				JoinGeometryUtils.JoinGeometry(doc,item1,item2)
				booleans.append(True)
			except:
				booleans.append(False)
TransactionManager.Instance.TransactionTaskDone()

#Assign your output to the OUT variable.
OUT = booleans
# ----------------------------------------
select_model_elements_2 = DSModelElementsSelection()  # 2 picked in the model
# note: Select Multiple Floors
select_model_elements_3 = DSModelElementsSelection()  # 3 picked in the model
# note: Select Element to be Joined
select_model_elements_4 = DSModelElementsSelection()  # 4 picked in the model
# note: Select Element to be Joined to
select_model_elements_5 = DSModelElementsSelection()  # 4 picked in the model
code_block = CodeBlock { 1; }

# group: SteamNodes
getSurroundingElements = Custom[Tool.GetSurroundingElements](Element=select_model_elements_4, ElementCheck=select_model_elements_5, Tolerance=code_block)  # Get Surrounding Elements by Categories, group them as List. Tolerance distance available.

flatten = Flatten()
map = List.Map(list=getSurroundingElements, f_x=flatten)
count = List.Count()
map_2 = List.Map(list=getSurroundingElements, f_x=count)
code_block_2 = CodeBlock { 1; }
gt = map_2 > code_block_2
filterByBoolMask = List.FilterByBoolMask(list=getSurroundingElements, mask=gt)
watch = Watch(filterByBoolMask.in)
python_script_3 = Python(IN[0]=filterByBoolMask.in)
# ---------- python_script_3.python (32 lines) ----------
import clr
clr.AddReference('RevitAPI')
from Autodesk.Revit.DB import *
from System.Collections.Generic import *
clr.AddReference("RevitServices")
import RevitServices
from RevitServices.Persistence import DocumentManager
from RevitServices.Transactions import TransactionManager

doc = DocumentManager.Instance.CurrentDBDocument

#The inputs to this node will be stored as a list in the IN variables.
dataEnteringNode = IN

items1 = UnwrapElement(IN[0])


TransactionManager.Instance.EnsureInTransaction(doc)
booleans=[]

for i in range (0,len(items1)):
	for j in range(0,len(items1[i])):
		try:
			JoinGeometryUtils.JoinGeometry(doc,items1[i][0],items1[i][j])
			booleans.append(True)
		except:
			booleans.append(False)

TransactionManager.Instance.TransactionTaskDone()

#Assign your output to the OUT variable.
OUT = booleans
# ----------------------------------------
joinGeometry = Custom[Element.JoinGeometry]()  # Joins two model elements (if possible). Only works inside the project environment.
