# Dynamo graph Kronz_RationalDiamondBall.dyn (Dynamo 1.3.0.875)

# group: Generate Spherical Surface
code_block = CodeBlock { 5; }
byCenterPointRadius = Sphere.ByCenterPointRadius(radius=code_block)
explode = Geometry.Explode(byCenterPointRadius)
firstItem = List.FirstItem(explode)

# group: Adjust Panel Resolution and Analysis Display
integer_slider = IntegerSlider(8, range=2..20 step 1)
integer_slider_2 = IntegerSlider(12, range=2..20 step 1)
analysis_density = IntegerSlider(5, range=3..10 step 1)
scale_midpoint_color = DoubleSlider(21, range=2..100 step 1)

# group: Diamond Panel by LunchBox
panelDiamond = Geometry.Panel.PanelDiamond(firstItem, integer_slider, integer_slider_2)
code_block_2 = CodeBlock(x=panelDiamond.out1) { x; }

# group: Constraints
coPlanarGoal_Create = DynaShape.ZeroTouch.Goals.CoPlanarGoal_Create(panelDiamond.out1)
shapeMatchingGoal_Create = DynaShape.ZeroTouch.Goals.ShapeMatchingGoal_Create(panelDiamond.out1)
polylineBinder = DynaShape.ZeroTouch.GeometryBinders.PolylineBinder(panelDiamond.out1)

join = List.Join(coPlanarGoal_Create, shapeMatchingGoal_Create)

# group: DynaShape Solver
# note: 1. At the beginning of a scenario, set "reset" to True to reset the solver.
# 2. Set "reset" to False.
# 3. Switch the Run Mode to Periodic and see the DynaShape solver iteratively move the nodes/vertices into their "desired" positions.
# Note: if the periodic update interval is set too low the Background View might appear to be frozen. In this case, increase the interval, switch the Run Mode to Automatic then back to Periodic, this should fix the problem
# 4. With mouseInteract set to True, you can switch to Background View and grab and pull the nodes/vertices around
create = DynaShape.ZeroTouch.Solver.Create()
number_slider = DoubleSlider(1, range=0..400 step 0.1)
boolean = BoolSelector(true)
boolean_2 = BoolSelector(false)
boolean_3 = BoolSelector(false)
boolean_4 = BoolSelector(true)
execute = DynaShape.ZeroTouch.Solver.Execute(create, join, polylineBinder, number_slider, boolean, boolean_2, boolean_3, boolean_4)
watch = Watch(execute.out3)

# group: Move Move original Geometry to New location for comparison
code_block_3 = CodeBlock { 12; }
translate = Geometry.Translate(geometry=panelDiamond.out0, yTranslation=code_block_3)

# group: Reconstruct Post DynaShape Panels
curves = PolyCurve.Curves(execute.out2)
firstItem_2 = List.FirstItem(curves@L2)
startPoint = Curve.StartPoint(firstItem_2)
endPoint = Curve.EndPoint(curves)
addItemToFront = List.AddItemToFront(item=startPoint@L1, list=endPoint@L2)
byPerimeterPoints = Surface.ByPerimeterPoints(addItemToFront)

# group: Curvature Analysis for Before and after Panels
code_block_4 = CodeBlock(n=analysis_density) { 0..1..#n; }
gaussianCurvatureAtParameter = Surface.GaussianCurvatureAtParameter(translate, code_block_4, code_block_4, lacing=CrossProduct)
gaussianCurvatureAtParameter_2 = Surface.GaussianCurvatureAtParameter(byPerimeterPoints, code_block_4, code_block_4, lacing=CrossProduct)

# group: Create common color scale based on min/max of original geometry curvature
code_block_5 = CodeBlock()
# ---------- code_block_5.designscript (4 lines) ----------
a=DSCore.Color.ByARGB(255, 255,0,0);
b=DSCore.Color.ByARGB(255, 255,255,0);
c=DSCore.Color.ByARGB(255, 0,0,255);
{a,b,c};
# ----------------------------------------
flatten = Flatten(gaussianCurvatureAtParameter)
minimumItem = List.MinimumItem(flatten)
code_block_6 = CodeBlock(x=gaussianCurvatureAtParameter, min=minimumItem) { x-min; }
flatten_2 = Flatten(code_block_6)
maximumItem = List.MaximumItem(flatten_2)
code_block_7 = CodeBlock(max=maximumItem, mid=scale_midpoint_color) { {0, max/mid, max}; }
code_block_8 = CodeBlock(x=code_block_6, max=maximumItem) { x*(1/max); }
color_range = ColorRange(code_block_5.out3, code_block_7, code_block_8)
code_block_9 = CodeBlock(x=gaussianCurvatureAtParameter_2, min=minimumItem) { x-min; }
code_block_10 = CodeBlock(x=code_block_9, max=maximumItem) { x*(1/max); }
color_range_2 = ColorRange(code_block_5.out3, code_block_7, code_block_10)

# group: Curvature Before Dynashape
bySurfaceColors = Display.Display.BySurfaceColors(translate, color_range)

# group: Curvature After Dynashape
bySurfaceColors_2 = Display.Display.BySurfaceColors(byPerimeterPoints, color_range_2)

code_block_11 = CodeBlock { 5; }
byRadiusHeight = Cylinder.ByRadiusHeight(arg1=code_block_11, arg2=code_block_11)
