# Dynamo graph Set Line Style.dyn (Dynamo 0.8.2.2392)

select_model_elements = DSModelElementsSelection()  # 101 picked in the model

# group: LENGTH
geometry = Element.Geometry(select_model_elements)
flatten = Flatten(geometry)
code_block = CodeBlock(a=flatten) { a.Length; }
code_block_2 = CodeBlock(a=code_block) { a==600; }

code_block_3 = CodeBlock(a=code_block) { a<400; }

# group (continued): LENGTH
filterByBoolMask = List.FilterByBoolMask(list=select_model_elements, mask=code_block_3)

setParameterByName = Element.SetParameterByName()
code_block_4 = CodeBlock { "Line Style"; }
python_script = Python()
# ---------- python_script.python (39 lines) ----------
import clr
clr.AddReference('ProtoGeometry')
from Autodesk.DesignScript.Geometry import *

# Import DocumentManager and TransactionManager
clr.AddReference("RevitServices")
import RevitServices
from RevitServices.Persistence import DocumentManager

# Import RevitAPI
clr.AddReference("RevitAPI")
import Autodesk
from Autodesk.Revit.DB import *

doc = DocumentManager.Instance.CurrentDBDocument

import sys
pyt_path = r'C:\Program Files (x86)\IronPython 2.7\Lib'
sys.path.append(pyt_path)

#The inputs to this node will be stored as a list in the IN variable.
dataEnteringNode = IN

try:
	errorReport = None
	cat = doc.Settings.Categories.get_Item(BuiltInCategory.OST_Lines)
	gs = cat.GetGraphicsStyle(GraphicsStyleType.Projection)
	gsCat = gs.GraphicsStyleCategory.SubCategories
	dataOut = [i.GetGraphicsStyle(GraphicsStyleType.Projection) for i in gsCat]
except:
	# if error accurs anywhere in the process catch it
	import traceback
	errorReport = traceback.format_exc()

#Assign your output to the OUT variable
if errorReport == None:
	OUT = dataOut
else:
	OUT = errorReport
# ----------------------------------------
name = Element.Name(python_script)
code_block_5 = CodeBlock { "1 Arup Cont"; }
code_block_6 = CodeBlock { 1; }
contains = String.Contains(str=name, searchFor=code_block_5, ignoreCase=code_block_6)
filterByBoolMask_2 = List.FilterByBoolMask(list=python_script, mask=contains)
combine = List.Combine(setParameterByName, code_block_4, filterByBoolMask_2.in)
code_block_7 = CodeBlock { "Line Style"; }
getParameterValueByName = Element.GetParameterValueByName(element=select_model_elements, parameterName=code_block_7)
name_2 = Element.Name(getParameterValueByName)
code_block_8 = CodeBlock { "Rebar Circle"; }
code_block_9 = CodeBlock { 1; }
contains_2 = String.Contains(str=name_2, searchFor=code_block_8, ignoreCase=code_block_9)
filterByBoolMask_3 = List.FilterByBoolMask(list=select_model_elements, mask=contains_2)
deleteElements = Custom[Doc.DeleteElements]()  # Attempts to delete the input list of elements from the active Revit document.The node returns the number of successfully deleted elements and their Ids as a string. Carefully observe the deleted elements count. It may be greater than the input list because hosted elements or tags will be deleted as well. If an element in the list can not be deleted (for example last revision or last view), the whole list will fail to be deleted.
select_model_elements_2 = DSModelElementsSelection()  # 125 picked in the model
python_script_2 = Python(IN[0]=select_model_elements_2)
# ---------- python_script_2.python (12 lines) ----------
import clr
clr.AddReference('RevitAPI')
from Autodesk.Revit.DB import *

textnotes = UnwrapElement(IN[0])
elementlist = list()
for item in textnotes:
	try:
		elementlist.append(item.Text)
	except:
		elementlist.append(list())
OUT = elementlist
# ----------------------------------------
code_block_10 = CodeBlock { "LD"; }
code_block_11 = CodeBlock { 1; }
contains_3 = String.Contains(str=python_script_2, searchFor=code_block_10, ignoreCase=code_block_11)
filterByBoolMask_4 = List.FilterByBoolMask(list=select_model_elements_2, mask=contains_3)
deleteElements_2 = Custom[Doc.DeleteElements]()
select_model_elements_3 = DSModelElementsSelection()  # 2 picked in the model
geometry_2 = Element.Geometry(select_model_elements_3)
code_block_12 = CodeBlock(a=geometry_2) { Flatten(a); }
startPoint = Curve.StartPoint(code_block_12)
endPoint = Curve.EndPoint(code_block_12)
create = List.Create(startPoint, endPoint)
flatten_2 = Flatten(create)
XAxis = Vector.XAxis()
ZAxis = Vector.ZAxis()
code_block_13 = CodeBlock { 0; }
rotate = Vector.Rotate(XAxis, ZAxis, code_block_13)
code_block_14 = CodeBlock { -90; }
rotate_2 = Vector.Rotate(rotate, ZAxis, code_block_14)
code_block_15 = CodeBlock { "TL"; }
code_block_16 = CodeBlock { 0.05; }
center = Custom[TextAlignFlags.Center]()  # Returns the "Left" text align flag.
python_script_3 = Python(IN[1]=flatten_2, IN[2]=rotate, IN[3]=rotate_2, IN[4]=code_block_15, IN[5]=code_block_16, IN[6]=center)
# ---------- python_script_3.python (33 lines) ----------
import clr
clr.AddReference('RevitAPI')
from Autodesk.Revit.DB import *

clr.AddReference("RevitNodes")
import Revit
clr.ImportExtensions(Revit.GeometryConversion)

clr.AddReference("RevitServices")
import RevitServices
from RevitServices.Persistence import DocumentManager
from RevitServices.Transactions import TransactionManager

doc = DocumentManager.Instance.CurrentDBDocument
view = UnwrapElement(IN[0])
xyzlist = [x.ToXyz() for x in IN[1]]
basevecs = UnwrapElement(IN[2])
upvecs = UnwrapElement(IN[3])
text = IN[4]
width = IN[5]
textalign = IN[6]
doccreation = doc.Create
counter = 0
elementlist = list()

TransactionManager.Instance.EnsureInTransaction(doc)

for item in xyzlist:
	elementlist.append(doccreation.NewTextNote(view,item, basevecs.ToXyz(), upvecs.ToXyz(), width, textalign,text))
	
TransactionManager.Instance.TransactionTaskDone()

OUT = elementlist,basevecs.ToXyz(),XYZ.BasisX
# ----------------------------------------
code_block_17 = CodeBlock { 1; }
active_view = Custom[Active View](refresh=code_block_17)
turn_into_list = Custom[Turn Into List](item=code_block_13)  # Turns an element (or a nested list) into a flat list
code_block_18 = CodeBlock(a=endPoint, b=startPoint) { Vector.ByTwoPoints(a,b); }
code_block_19 = CodeBlock { 2000; }
translate = Geometry.Translate(geometry=startPoint, direction=code_block_18, distance=code_block_19)
scale1D = CoordinateSystem.Scale1D()
