# Dynamo graph All indices of.dyn (Dynamo 1.2.1.3083)

code_block = CodeBlock { {"e","c","a","d","b"}; }
code_block_2 = CodeBlock { {"a","b","c","d","e"}; }
python_script = Python(IN[0]=code_block, IN[1]=code_block_2)
# ---------- python_script.python (13 lines) ----------
lst = IN[0]

fnd = IN[1]

newlst = []

for item in fnd:
	for i in range(0,len(lst)):
		if item == lst[i]:
			newlst.append(lst.index(lst[i]))

#Assign your output to the OUT variable.
OUT = newlst
# ----------------------------------------
indexOf = IndexOf(code_block)  # unwired: arg1
map = List.Map(list=code_block_2, f_x=indexOf)
getItemAtIndex = List.GetItemAtIndex(list=code_block, index=map)
allIndicesOf = List.AllIndicesOf(list=code_block_2, item=code_block)
getItemAtIndex_2 = List.GetItemAtIndex(list=code_block_2, index=allIndicesOf)
