# Dynamo graph Remove Item from list.dyn (Dynamo 0.8.2.2392)

code_block = CodeBlock { 1..10; }
code_block_2 = CodeBlock { {2,4,6}; }
python_script = Python(IN[0]=code_block, IN[1]=code_block_2)
# ---------- python_script.python (11 lines) ----------
list = IN[0]

itemTofind = IN[1]

for i in range(0,len(itemTofind)):
    
    list = filter(lambda a: a != itemTofind[i], list)


#Assign your output to the OUT variable.
OUT = list
# ----------------------------------------
code_block_3 = CodeBlock { 1..10; }
code_block_4 = CodeBlock { {2,4,6}; }
eq = code_block_3 == code_block_4  # lacing=CrossProduct
countTrue = CountTrue(eq, lacing=Longest)
code_block_5 = CodeBlock { 1; }
eq_2 = countTrue == code_block_5  # lacing=CrossProduct
flatten = Flatten(eq_2)
filterByBoolMask = List.FilterByBoolMask(list=code_block_3, mask=flatten)
watch = Watch(filterByBoolMask.out)
python_script_2 = Python(IN[0]=code_block, IN[1]=code_block_2)
# ---------- python_script_2.python (14 lines) ----------
list = IN[0]

itemTofind = IN[1]

bol = []

for item in itemTofind:
	for i in range(0,len(list)):
	    if item == list[i]:
	    	bol.append(list.index(list[i]))


#Assign your output to the OUT variable.
OUT = bol
# ----------------------------------------
watch_2 = Watch(filterByBoolMask.in)
python_script_3 = Python(IN[0]=code_block, IN[1]=code_block_2)
# ---------- python_script_3.python (14 lines) ----------
list = IN[0]

itemTofind = IN[1]

bol = []

for item in itemTofind:
	for i in range(0,len(list)):
	    if item == list[i]:
	    	bol.append(list[i])


#Assign your output to the OUT variable.
OUT = bol
# ----------------------------------------
code_block_6 = CodeBlock { true; }
code_block_7 = CodeBlock { false; }
if_ = If(test=countTrue, true=code_block_6, false=code_block_7)
filterByBoolMask_2 = List.FilterByBoolMask(list=code_block_3, mask=if_)
