# Dynamo graph find item in list.dyn (Dynamo 1.2.1.3083)

code_block = CodeBlock { {1..10,5,3}; }
code_block_2 = CodeBlock(a=code_block) { Flatten(a); }
code_block_3 = CodeBlock { {3,4}; }
python_script = Python(IN[0]=code_block_2, IN[1]=code_block_3)
# ---------- python_script.python (20 lines) ----------
import clr
clr.AddReference('ProtoGeometry')
from Autodesk.DesignScript.Geometry import *
#The inputs to this node will be stored as a list in the IN variables.
lista = IN[0]
inlista = IN[1]

def find(lst, a):
    result = []
    for i, x in enumerate(lst):
        for item in a:
            if x==item:
                result.append(i)
    return result




#Assign your output to the OUT variable.
OUT = find(lista, inlista)
# ----------------------------------------
create = List.Create()  # unwired: arg0
