# Dynamo graph Detail_Lines_To_Pipes_0.02a.dyn (Dynamo 1.3.0.875)

select_model_elements = DSModelElementsSelection()  # 1 picked in the model; frozen
parameters = Element.Parameters(select_model_elements)
watch = Watch(parameters)
python_script = Python(IN[0]=select_model_elements)
# ---------- python_script.python (25 lines) ----------
import clr

clr.AddReference("RevitServices")
import RevitServices
from RevitServices.Persistence import DocumentManager
from RevitServices.Transactions import TransactionManager
doc = DocumentManager.Instance.CurrentDBDocument

clr.AddReference("RevitAPI")
import Autodesk
from Autodesk.Revit.DB import *

clr.AddReference("RevitNodes")
import Revit
clr.ImportExtensions(Revit.Elements)
clr.ImportExtensions(Revit.GeometryConversion)

toggle = ""

pipe = UnwrapElement(IN[0])

mepS= pipe.MEPSystem.GetTypeId();


OUT = mepS
# ----------------------------------------
select_model_elements_2 = DSModelElementsSelection()  # 5 picked in the model
curves = Element.Curves(select_model_elements_2)
code_block = CodeBlock { {0,1}; }
pointAtParameter = Curve.PointAtParameter(curve=curves@L1, param=code_block, lacing=CrossProduct)
code_block_2 = CodeBlock { "Type"; }
getParameterValueByName = Element.GetParameterValueByName(element=select_model_elements, parameterName=code_block_2)
watch_2 = Watch(getParameterValueByName)
code_block_3 = CodeBlock { "System Type"; }
getParameterValueByName_2 = Element.GetParameterValueByName(element=select_model_elements, parameterName=code_block_3)
watch_3 = Watch(getParameterValueByName_2)
levels = Levels("00")
python_script_2 = Python(IN[0]=pointAtParameter, IN[1]=watch_2, IN[2]=watch_3, IN[3]=levels)
# ---------- python_script_2.python (36 lines) ----------
import clr

clr.AddReference("RevitServices")
import RevitServices
from RevitServices.Persistence import DocumentManager
from RevitServices.Transactions import TransactionManager
doc = DocumentManager.Instance.CurrentDBDocument

clr.AddReference("RevitAPI")
import Autodesk
from Autodesk.Revit.DB import *

clr.AddReference("RevitNodes")
import Revit
clr.ImportExtensions(Revit.Elements)
clr.ImportExtensions(Revit.GeometryConversion)


pts = IN[0]
pipetype = UnwrapElement(IN[1])
systemtype = UnwrapElement(IN[2])
level = UnwrapElement(IN[3])



elements = []

TransactionManager.Instance.EnsureInTransaction(doc)
for i in range(0,len(pts)):
	pipe = Autodesk.Revit.DB.Plumbing.Pipe.CreatePlaceholder(doc,systemtype.Id,pipetype.Id,level.Id,pts[i][0].ToXyz(),pts[i][1].ToXyz())
	elements.append(pipe)

TransactionManager.Instance.TransactionTaskDone()


OUT = elements
# ----------------------------------------

# group: Pipe Elbow Fittings
organisePipes = Custom[OrganisePipes](element=select_model_elements_2)  # frozen; divide lines into elbows, tees and crossess
code_block_4 = CodeBlock(a=organisePipes.Tees, b=organisePipes.Crosses, c=organisePipes.Elbows) { {a,b,c}; }
getItemAtIndex = List.GetItemAtIndex(list=python_script_2, index=code_block_4)
code_block_5 = CodeBlock(a=getItemAtIndex) { a[2]; }
ELBOWS = Python(IN[0]=code_block_5)
# ---------- ELBOWS.python (44 lines) ----------
import clr

clr.AddReference("RevitServices")
import RevitServices
from RevitServices.Persistence import DocumentManager
from RevitServices.Transactions import TransactionManager
doc = DocumentManager.Instance.CurrentDBDocument

clr.AddReference("RevitAPI")
import Autodesk
from Autodesk.Revit.DB import *

clr.AddReference("RevitNodes")
import Revit
clr.ImportExtensions(Revit.Elements)
clr.ImportExtensions(Revit.GeometryConversion)

clr.AddReference("System")
from System.Collections.Generic import List

pipes = UnwrapElement(IN[0])


elements = []
others = []

others.append(pipes[0])

TransactionManager.Instance.EnsureInTransaction(doc)
	#pipe = Autodesk.Revit.DB.Plumbing.Pipe.Create(doc,systemtype.Id,pipetype.Id,level[0].Id,FirstPoint[i].ToXyz(),SecondPoint[i].ToXyz())
#pipe = Autodesk.Revit.DB.Plumbing.PlumbingUtils.ConvertPipePlaceholders(doc, col1)

for i in range(0,len(pipes)-1):
	try:
		pipe = Autodesk.Revit.DB.Plumbing.PlumbingUtils.ConnectPipePlaceholdersAtElbow(doc, pipes[i].Id, pipes[i+1].Id)
		elements.append(pipes[i])
	except:
		others.append(pipes[i])

#elements.append(pipe.ToDSType(False))

TransactionManager.Instance.TransactionTaskDone()

OUT = elements, others
# ----------------------------------------
code_block_6 = CodeBlock(a=getItemAtIndex) { a[2]; }
code_block_7 = CodeBlock(a=getItemAtIndex) { a[0]; }
code_block_8 = CodeBlock { 0; }
getSurroundingElements = Custom[Tee](Element=code_block_6, ElementCheck=code_block_7, Tolerance=code_block_8)  # "Tool.GetSurroundingElements"; Get Surrounding Elements by Categories, group them as List. Tolerance distance available.
tee = Python(IN[0]=getSurroundingElements)
# ---------- tee.python (39 lines) ----------
import clr

clr.AddReference("RevitServices")
import RevitServices
from RevitServices.Persistence import DocumentManager
from RevitServices.Transactions import TransactionManager
doc = DocumentManager.Instance.CurrentDBDocument

clr.AddReference("RevitAPI")
import Autodesk
from Autodesk.Revit.DB import *

clr.AddReference("RevitNodes")
import Revit
clr.ImportExtensions(Revit.Elements)
clr.ImportExtensions(Revit.GeometryConversion)

clr.AddReference("System")
from System.Collections.Generic import List

pipes = UnwrapElement(IN[0])

elements = []
tees = []

TransactionManager.Instance.EnsureInTransaction(doc)
	#pipe = Autodesk.Revit.DB.Plumbing.Pipe.Create(doc,systemtype.Id,pipetype.Id,level[0].Id,FirstPoint[i].ToXyz(),SecondPoint[i].ToXyz())
#pipe = Autodesk.Revit.DB.Plumbing.PlumbingUtils.ConvertPipePlaceholders(doc, col1)

for i in range(0,len(pipes)):
	for j in range(1,len(pipes[i])):
		pipe = Autodesk.Revit.DB.Plumbing.PlumbingUtils.ConnectPipePlaceholdersAtTee(doc, pipes[i][0].Id, pipes[i][j].Id)
		elements.append(pipe)
		tees.append(pipes[i][0])
#elements.append(pipe.ToDSType(False))

TransactionManager.Instance.TransactionTaskDone()

OUT = elements,tees
# ----------------------------------------
code_block_9 = CodeBlock(a=getItemAtIndex) { a[2]; }
code_block_10 = CodeBlock(a=getItemAtIndex) { a[1]; }
code_block_11 = CodeBlock { 0; }
getSurroundingElements_2 = Custom[Cross](Element=code_block_9, ElementCheck=code_block_10, Tolerance=code_block_11)  # "Tool.GetSurroundingElements"; Get Surrounding Elements by Categories, group them as List. Tolerance distance available.
cross = Python(IN[0]=getSurroundingElements_2)
# ---------- cross.python (39 lines) ----------
import clr

clr.AddReference("RevitServices")
import RevitServices
from RevitServices.Persistence import DocumentManager
from RevitServices.Transactions import TransactionManager
doc = DocumentManager.Instance.CurrentDBDocument

clr.AddReference("RevitAPI")
import Autodesk
from Autodesk.Revit.DB import *

clr.AddReference("RevitNodes")
import Revit
clr.ImportExtensions(Revit.Elements)
clr.ImportExtensions(Revit.GeometryConversion)

clr.AddReference("System")
from System.Collections.Generic import List

pipes = UnwrapElement(IN[0])

elements = []
tees = []

TransactionManager.Instance.EnsureInTransaction(doc)
	#pipe = Autodesk.Revit.DB.Plumbing.Pipe.Create(doc,systemtype.Id,pipetype.Id,level[0].Id,FirstPoint[i].ToXyz(),SecondPoint[i].ToXyz())
#pipe = Autodesk.Revit.DB.Plumbing.PlumbingUtils.ConvertPipePlaceholders(doc, col1)

for i in range(0,len(pipes)):
	for j in range(1,len(pipes[i])):
		pipe = Autodesk.Revit.DB.Plumbing.PlumbingUtils.ConnectPipePlaceholdersAtCross(doc, pipes[i][0].Id, pipes[i][j].Id)
		elements.append(pipe)
		tees.append(pipes[i][0])
#elements.append(pipe.ToDSType(False))

TransactionManager.Instance.TransactionTaskDone()

OUT = elements,tees
# ----------------------------------------

parameters_2 = Element.Parameters(select_model_elements_2)
watch_4 = Watch(parameters_2)
ui_textbox_data = Custom[UI.TextBox Data]()  # Create Data for TextBox input in UI.MultipleInputForm ++ . Check out www.data-shapes.net for more informations
categories = Categories("PipingSystem")
all_elements_of_category = ElementsOfCategory(categories)
parameters_3 = Element.Parameters(all_elements_of_category)
watch_5 = Watch(parameters_3)
code_block_12 = CodeBlock { "Type"; }
getParameterValueByName_3 = Element.GetParameterValueByName(element=all_elements_of_category, parameterName=code_block_12)
watch_6 = Watch(getParameterValueByName_3)
parameters_4 = Element.Parameters(watch_6)
watch_7 = Watch(parameters_4)
code_block_13 = CodeBlock { "Line Style"; }
getParameterValueByName_4 = Element.GetParameterValueByName(element=select_model_elements_2, parameterName=code_block_13)
watch_8 = Watch(getParameterValueByName_4)
uniqueItems = List.UniqueItems(watch_8)
name = Parameter.Name(uniqueItems)
watch_9 = Watch(name)
watch_10 = Watch(watch_9)
boolean = BoolSelector(true)
categories_2 = Categories("PipeCurves")
all_elements_of_category_2 = ElementsOfCategory(categories_2)
parameters_5 = Element.Parameters(all_elements_of_category_2)
sort = List.Sort()  # unwired: arg0
boolean_2 = BoolSelector(true)
code_block_14 = CodeBlock { "Type Name"; }
getParameterValueByName_5 = Element.GetParameterValueByName(element=watch_6, parameterName=code_block_14)
uniqueItems_2 = List.UniqueItems(getParameterValueByName_5)
watch_11 = Watch(uniqueItems_2)
flatten = Flatten(watch_9)
watch_12 = Watch(uniqueItems_2)
ui_dropdown_data = Custom[UI.DropDown Data](InputName=flatten, Keys=watch_12, Values=watch_12)  # Create data for DropDown input in UI.MultiInputForm ++ . Check out www.data-shapes.net for more infos.
code_block_15 = CodeBlock { "Type"; }
getParameterValueByName_6 = Element.GetParameterValueByName(element=all_elements_of_category_2, parameterName=code_block_15)
uniqueItems_3 = List.UniqueItems(getParameterValueByName_6)
name_2 = Parameter.Name(uniqueItems_3)
watch_13 = Watch(name_2)
ui_dropdown_data_2 = Custom[UI.DropDown Data](InputName=flatten, Keys=watch_13, Values=watch_13)
create = List.Create(ui_dropdown_data, ui_dropdown_data_2)
flatten_2 = Flatten(create)
boolean_3 = BoolSelector(true)
ui_multipleinputform = Custom[UI.MultipleInputForm ++](Inputs=flatten_2, Toggle=boolean_3)  # Create a form with multiple inputs. see www.data-shapes.net for tutorials and infos!
watch_14 = Watch(ui_multipleinputform.User_Inputs)
allIndicesOf = List.AllIndicesOf(list=watch_11, item=watch_14)
getItemAtIndex_2 = List.GetItemAtIndex(list=watch_6, index=allIndicesOf)
allIndicesOf_2 = List.AllIndicesOf(list=watch_13, item=watch_14)
getItemAtIndex_3 = List.GetItemAtIndex(list=getParameterValueByName_6, index=allIndicesOf_2)
create_2 = List.Create(getItemAtIndex_2, getItemAtIndex_3)
lunchbox_remove_null_values = Custom[LunchBox Remove Null Values](List=create_2)  # Remove 'null' values from a list.
flatten_3 = Flatten(create_2)
watch_15 = Watch(flatten_3)
count = Count(watch_15)
code_block_16 = CodeBlock(a=count) { a/2; }
code_block_17 = CodeBlock(a=code_block_16) { a-1; }
code_block_18 = CodeBlock(a=code_block_17) { 0..a..1; }
getItemAtIndex_4 = List.GetItemAtIndex(list=watch_15, index=code_block_18)
watch_16 = Watch(getItemAtIndex_4)
watch_17 = Watch(code_block_16)
code_block_19 = CodeBlock(a=count, b=watch_17) { a-b; }
code_block_20 = CodeBlock(c=code_block_19, a=count) { c..a..1; }
dropLastItem = Custom[List.DropLastItem](list=code_block_20)  # Drops the last item from a given list.
getItemAtIndex_5 = List.GetItemAtIndex(list=watch_15, index=dropLastItem)
watch_18 = Watch(getItemAtIndex_5)
create_3 = List.Create(watch_16, watch_18)
watch_19 = Watch(create_3)
count_2 = Count(watch_18)
code_block_21 = CodeBlock(a=count_2) { a-1; }
code_block_22 = CodeBlock(a=code_block_21) { 0..a..1; }
getItemAtIndex_6 = List.GetItemAtIndex(list=watch_19, index=code_block_22)
removeNulls = Lists.Manage.RemoveNulls(getItemAtIndex_6)
watch_20 = Watch(removeNulls)

# group: Pipe System and Types Split
watch_21 = Watch(watch_20)
flatten_4 = Flatten(watch_20)
code_block_23 = CodeBlock { "Family Name"; }
getParameterValueByName_7 = Element.GetParameterValueByName(element=flatten_4, parameterName=code_block_23)
watch_22 = Watch(getParameterValueByName_7)
code_block_24 = CodeBlock { "Piping System"; }
eq = watch_22 == code_block_24
filterByBoolMask = List.FilterByBoolMask(list=flatten_4, mask=eq)
type = Watch(filterByBoolMask.out)
systen = Watch(filterByBoolMask.in)

watch_23 = Watch(pointAtParameter)
curves_2 = Element.Curves(select_model_elements_2)
code_block_25 = CodeBlock { {0,1}; }
pointAtParameter_2 = Curve.PointAtParameter(curve=curves_2@L1, param=code_block_25, lacing=CrossProduct)
watch_24 = Watch(pointAtParameter_2)
levels_2 = Levels("00")
creates_pipes_placeholders = Python(IN[0]=pointAtParameter_2, IN[1]=type, IN[2]=systen, IN[3]=levels_2)  # same code as python_script_2
watch_25 = Watch(creates_pipes_placeholders)
watch_26 = Watch(watch_9)
line_types = Watch(watch_26)
watch_27 = Watch(curves_2)
