# Dynamo graph Detail_Lines_To_Pipes_Geometry01.dyn (Dynamo 1.3.0.875)

select_model_elements = DSModelElementsSelection()  # 11 picked in the model

# group: DataShapes UI Inputs
categories = Categories("PipeCurves")
all_elements_of_category = ElementsOfCategory(categories)
code_block = CodeBlock { "Type"; }
getParameterValueByName = Element.GetParameterValueByName(element=all_elements_of_category, parameterName=code_block)
uniqueItems = List.UniqueItems(getParameterValueByName)
name = Parameter.Name(uniqueItems)
code_block_2 = CodeBlock { "Line Style"; }  # frozen
getParameterValueByName_2 = Element.GetParameterValueByName(element=select_model_elements, parameterName=code_block_2)
watch = Watch(getParameterValueByName_2)
uniqueItems_2 = List.UniqueItems(watch)
name_2 = Parameter.Name(uniqueItems_2)
watch_2 = Watch(name_2)
categories_2 = Categories("PipingSystem")
all_elements_of_category_2 = ElementsOfCategory(categories_2)
code_block_3 = CodeBlock { "Type"; }
getParameterValueByName_3 = Element.GetParameterValueByName(element=all_elements_of_category_2, parameterName=code_block_3)
uniqueItems_3 = List.UniqueItems(getParameterValueByName_3)
watch_3 = Watch(uniqueItems_3)
code_block_4 = CodeBlock { "Type Name"; }
getParameterValueByName_4 = Element.GetParameterValueByName(element=watch_3, parameterName=code_block_4)
uniqueItems_4 = List.UniqueItems(getParameterValueByName_4)

# group: DataShapes - UI Secton + Output
flatten = Flatten(watch_2)
ui_dropdown_data = Custom[UI.DropDown Data](InputName=flatten, Keys=uniqueItems_4, Values=uniqueItems_4)  # Create data for DropDown input in UI.MultiInputForm ++ . Check out www.data-shapes.net for more infos.
ui_dropdown_data_2 = Custom[UI.DropDown Data](InputName=flatten, Keys=name, Values=name)
create = List.Create(ui_dropdown_data, ui_dropdown_data_2)
flatten_2 = Flatten(create)
boolean = BoolSelector(true)
ui_multipleinputform = Custom[UI.MultipleInputForm ++](Inputs=flatten_2, Toggle=boolean)  # Create a form with multiple inputs. see www.data-shapes.net for tutorials and infos!
allIndicesOf = List.AllIndicesOf(list=name, item=ui_multipleinputform.User_Inputs)
getItemAtIndex = List.GetItemAtIndex(list=getParameterValueByName, index=allIndicesOf@L1)
code_block_5 = CodeBlock(PipeTypeList=getItemAtIndex) { Flatten(PipeTypeList); }
code_block_6 = CodeBlock { "Line Style"; }
getParameterValueByName_5 = Element.GetParameterValueByName(element=select_model_elements, parameterName=code_block_6)
name_3 = Element.Name(getParameterValueByName_5)
allIndicesOf_2 = List.AllIndicesOf(list=watch_2, item=name_3)
getItemAtIndex_2 = List.GetItemAtIndex(list=code_block_5, index=allIndicesOf_2@L1)
allIndicesOf_3 = List.AllIndicesOf(list=uniqueItems_4, item=ui_multipleinputform.User_Inputs)
getItemAtIndex_3 = List.GetItemAtIndex(list=watch_3, index=allIndicesOf_3@L1)
code_block_7 = CodeBlock(SystemTypeList=getItemAtIndex_3) { Flatten(SystemTypeList); }
getItemAtIndex_4 = List.GetItemAtIndex(list=code_block_7, index=allIndicesOf_2@L1)
watch_4 = Watch(ui_multipleinputform.User_Inputs)

# group: Pipe PlaceHolder Creation
curves = Element.Curves(select_model_elements)
code_block_8 = CodeBlock { {0,1}; }
pointAtParameter = Curve.PointAtParameter(curve=curves@L1, param=code_block_8, lacing=CrossProduct)
watch_5 = Watch(getItemAtIndex_2)
watch_6 = Watch(getItemAtIndex_4)
levels = Levels()
watch_7 = Watch(pointAtParameter)

watch_8 = Watch(pointAtParameter)
watch_9 = Watch(watch_5)
watch_10 = Watch(watch_6)
watch_11 = Watch(levels)

# group (continued): Pipe PlaceHolder Creation
creates_pipes_placeholders = Python(IN[0]=watch_8, IN[1]=watch_9, IN[2]=watch_10, IN[3]=watch_11)
# ---------- creates_pipes_placeholders.python (36 lines) ----------
import clr

clr.AddReference("RevitServices")
import RevitServices
from RevitServices.Persistence import DocumentManager
from RevitServices.Transactions import TransactionManager
doc = DocumentManager.Instance.CurrentDBDocument

clr.AddReference("RevitAPI")
import Autodesk
from Autodesk.Revit.DB import *

clr.AddReference("RevitNodes")
import Revit
clr.ImportExtensions(Revit.Elements)
clr.ImportExtensions(Revit.GeometryConversion)


pts = IN[0]
pipetype = UnwrapElement(IN[1])
systemtype = UnwrapElement(IN[2])
level = UnwrapElement(IN[3])



elements = []

TransactionManager.Instance.EnsureInTransaction(doc)
for i in range(0,len(pts)):
	pipe = Autodesk.Revit.DB.Plumbing.Pipe.CreatePlaceholder(doc,systemtype[i].Id,pipetype[i].Id,level.Id,pts[i][0].ToXyz(),pts[i][1].ToXyz())
	elements.append(pipe)

TransactionManager.Instance.TransactionTaskDone()


OUT = elements
# ----------------------------------------
watch_12 = Watch(creates_pipes_placeholders)

# group: Pipe Elbow Fittings
organisePipes = Custom[OrganisePipes](element=select_model_elements)  # divide lines into elbows, tees and crossess
code_block_9 = CodeBlock(a=organisePipes.Tees, b=organisePipes.Crosses, c=organisePipes.Elbows) { {a,b,c}; }
getItemAtIndex_5 = List.GetItemAtIndex(list=watch_12, index=code_block_9)
code_block_10 = CodeBlock(a=getItemAtIndex_5) { a[2]; }
ELBOWS = Python(IN[0]=code_block_10)
# ---------- ELBOWS.python (44 lines) ----------
import clr

clr.AddReference("RevitServices")
import RevitServices
from RevitServices.Persistence import DocumentManager
from RevitServices.Transactions import TransactionManager
doc = DocumentManager.Instance.CurrentDBDocument

clr.AddReference("RevitAPI")
import Autodesk
from Autodesk.Revit.DB import *

clr.AddReference("RevitNodes")
import Revit
clr.ImportExtensions(Revit.Elements)
clr.ImportExtensions(Revit.GeometryConversion)

clr.AddReference("System")
from System.Collections.Generic import List

pipes = UnwrapElement(IN[0])


elements = []
others = []

others.append(pipes[0])

TransactionManager.Instance.EnsureInTransaction(doc)
	#pipe = Autodesk.Revit.DB.Plumbing.Pipe.Create(doc,systemtype.Id,pipetype.Id,level[0].Id,FirstPoint[i].ToXyz(),SecondPoint[i].ToXyz())
#pipe = Autodesk.Revit.DB.Plumbing.PlumbingUtils.ConvertPipePlaceholders(doc, col1)

for i in range(0,len(pipes)-1):
	try:
		pipe = Autodesk.Revit.DB.Plumbing.PlumbingUtils.ConnectPipePlaceholdersAtElbow(doc, pipes[i].Id, pipes[i+1].Id)
		elements.append(pipes[i])
	except:
		others.append(pipes[i])

#elements.append(pipe.ToDSType(False))

TransactionManager.Instance.TransactionTaskDone()

OUT = elements, others
# ----------------------------------------
code_block_11 = CodeBlock(a=getItemAtIndex_5) { a[2]; }
code_block_12 = CodeBlock(a=getItemAtIndex_5) { a[0]; }
code_block_13 = CodeBlock { 0; }
getSurroundingElements = Custom[Tee](Element=code_block_11, ElementCheck=code_block_12, Tolerance=code_block_13)  # "Tool.GetSurroundingElements"; Get Surrounding Elements by Categories, group them as List. Tolerance distance available.
tee = Python(IN[0]=getSurroundingElements)
# ---------- tee.python (39 lines) ----------
import clr

clr.AddReference("RevitServices")
import RevitServices
from RevitServices.Persistence import DocumentManager
from RevitServices.Transactions import TransactionManager
doc = DocumentManager.Instance.CurrentDBDocument

clr.AddReference("RevitAPI")
import Autodesk
from Autodesk.Revit.DB import *

clr.AddReference("RevitNodes")
import Revit
clr.ImportExtensions(Revit.Elements)
clr.ImportExtensions(Revit.GeometryConversion)

clr.AddReference("System")
from System.Collections.Generic import List

pipes = UnwrapElement(IN[0])

elements = []
tees = []

TransactionManager.Instance.EnsureInTransaction(doc)
	#pipe = Autodesk.Revit.DB.Plumbing.Pipe.Create(doc,systemtype.Id,pipetype.Id,level[0].Id,FirstPoint[i].ToXyz(),SecondPoint[i].ToXyz())
#pipe = Autodesk.Revit.DB.Plumbing.PlumbingUtils.ConvertPipePlaceholders(doc, col1)

for i in range(0,len(pipes)):
	for j in range(1,len(pipes[i])):
		pipe = Autodesk.Revit.DB.Plumbing.PlumbingUtils.ConnectPipePlaceholdersAtTee(doc, pipes[i][0].Id, pipes[i][j].Id)
		elements.append(pipe)
		tees.append(pipes[i][0])
#elements.append(pipe.ToDSType(False))

TransactionManager.Instance.TransactionTaskDone()

OUT = elements,tees
# ----------------------------------------
code_block_14 = CodeBlock(a=getItemAtIndex_5) { a[2]; }
code_block_15 = CodeBlock(a=getItemAtIndex_5) { a[1]; }
code_block_16 = CodeBlock { 0; }
getSurroundingElements_2 = Custom[Cross](Element=code_block_14, ElementCheck=code_block_15, Tolerance=code_block_16)  # "Tool.GetSurroundingElements"; Get Surrounding Elements by Categories, group them as List. Tolerance distance available.
cross = Python(IN[0]=getSurroundingElements_2)
# ---------- cross.python (39 lines) ----------
import clr

clr.AddReference("RevitServices")
import RevitServices
from RevitServices.Persistence import DocumentManager
from RevitServices.Transactions import TransactionManager
doc = DocumentManager.Instance.CurrentDBDocument

clr.AddReference("RevitAPI")
import Autodesk
from Autodesk.Revit.DB import *

clr.AddReference("RevitNodes")
import Revit
clr.ImportExtensions(Revit.Elements)
clr.ImportExtensions(Revit.GeometryConversion)

clr.AddReference("System")
from System.Collections.Generic import List

pipes = UnwrapElement(IN[0])

elements = []
tees = []

TransactionManager.Instance.EnsureInTransaction(doc)
	#pipe = Autodesk.Revit.DB.Plumbing.Pipe.Create(doc,systemtype.Id,pipetype.Id,level[0].Id,FirstPoint[i].ToXyz(),SecondPoint[i].ToXyz())
#pipe = Autodesk.Revit.DB.Plumbing.PlumbingUtils.ConvertPipePlaceholders(doc, col1)

for i in range(0,len(pipes)):
	for j in range(1,len(pipes[i])):
		pipe = Autodesk.Revit.DB.Plumbing.PlumbingUtils.ConnectPipePlaceholdersAtCross(doc, pipes[i][0].Id, pipes[i][j].Id)
		elements.append(pipe)
		tees.append(pipes[i][0])
#elements.append(pipe.ToDSType(False))

TransactionManager.Instance.TransactionTaskDone()

OUT = elements,tees
# ----------------------------------------

watch_13 = Watch(allIndicesOf_2)
code_block_17 = CodeBlock {  }

# group: Offset Control
code_block_18 = CodeBlock { "System Type"; }
getParameterValueByName_6 = Element.GetParameterValueByName(element=watch_12, parameterName=code_block_18)
name_4 = Parameter.Name(getParameterValueByName_6)
uniqueItems_5 = List.UniqueItems(name_4)
allIndicesOf_4 = List.AllIndicesOf(list=name_4, item=uniqueItems_5)
getItemAtIndex_6 = List.GetItemAtIndex(list=watch_12, index=allIndicesOf_4)
watch_14 = Watch(getItemAtIndex_6)
code_block_19 = CodeBlock { "Offset"; }
code_block_20 = CodeBlock { 0; 500; 1000; 1500; 2000; 2500; 3000; 3500; 4000; }
create_2 = List.Create(code_block_20.out0, code_block_20.out1, code_block_20.out2, code_block_20.out3, code_block_20.out4, code_block_20.out5, code_block_20.out6, code_block_20.out7, code_block_20.out8)
setParameterByName = Element.SetParameterByName(element=watch_14, parameterName=code_block_19, value=create_2)
watch_15 = Watch(setParameterByName)

python_script = Python(IN[0]=watch_15)  # frozen
# ---------- python_script.python (38 lines) ----------
import clr

clr.AddReference("RevitServices")
import RevitServices
from RevitServices.Persistence import DocumentManager
from RevitServices.Transactions import TransactionManager
doc = DocumentManager.Instance.CurrentDBDocument

clr.AddReference("RevitAPI")
import Autodesk
from Autodesk.Revit.DB import *

clr.AddReference("RevitNodes")
import Revit
clr.ImportExtensions(Revit.Elements)
clr.ImportExtensions(Revit.GeometryConversion)

clr.AddReference("System")
from System.Collection.Generic import list

pipes = UnwarpElement(IN[0])

pipesIds = []

for p in pipes:
	pipesIds.append(p.Id)

col1 = List(ElementId](pipesIds)

elements = []

TransactionManager.Instance.EnsureInTransaction(doc)

pipe = Autodesk.Revit.Plumbing.PlumbingUtils.ConvertPipePlaceholders(doc, col1)

TransactionManager.Instance.TransactionTaskDone()

OUT = col1
# ----------------------------------------
passthrough = Custom[Passthrough](passThrough=python_script, waitFor=watch_12)  # Forces a sequential order of execution. The node wired into the output of the Passthrough node will be executed *after* the node wired into the waitFor input (e.g. important for some Revit operations). The value of the passThrough input will be passed on to the node wired into the output port of the Passthrough node.
watch_16 = Watch(passthrough)
watch_17 = Watch(python_script)
code_block_21 = CodeBlock {  }
watch_18 = Watch(getParameterValueByName_6)
parameters = Element.Parameters(watch_18)
watch_19 = Watch(parameters)
name_5 = Parameter.Name(watch_18)
watch_20 = Watch(name_5)
code_block_22 = CodeBlock { "System Name"; }
getParameterValueByName_7 = Element.GetParameterValueByName(element=watch_12, parameterName=code_block_22)
watch_21 = Watch(getParameterValueByName_7)
code_block_23 = CodeBlock { 0; }
getItemAtIndex_7 = List.GetItemAtIndex(list=getParameterValueByName_7, index=code_block_23)
setParameterByName_2 = Element.SetParameterByName(element=watch_12, parameterName=code_block_22, value=getItemAtIndex_7)
watch_22 = Watch(setParameterByName_2)
code_block_24 = CodeBlock {  }
this_is_the_pipes_broken_down_by = Watch(watch_15)  # "This is the pipes broken down by system"
doesIntersect = Geometry.DoesIntersect(geometry=this_is_the_pipes_broken_down_by, other=this_is_the_pipes_broken_down_by)
python_script_2 = Python()  # frozen; unwired: IN[0]
# ---------- python_script_2.python (29 lines) ----------
import clr

clr.AddReference("RevitServices")
import RevitServices
from RevitServices.Persistence import DocumentManager
from RevitServices.Transactions import TransactionManager
doc = DocumentManager.Instance.CurrentDBDocument

clr.AddReference("RevitAPI")
import Autodesk
from Autodesk.Revit.DB import *

clr.AddReference("RevitNodes")
import Revit
clr.ImportExtensions(Revit.Elements)
clr.ImportExtensions(Revit.GeometryConversion)

pph = IN[0]


TransactionManager.Instance.EnsureInTransaction(doc)
for i in range(0,len(pts)):
	pipe = Autodesk.Revit.Plumbing.Pipe.ConvertPipePlaceholders(doc,pph[i].id)
	elements.append(pipe)
	
TransactionManager.Instance.TransactionTaskDone()
OUT = elements

	
# ----------------------------------------
curves_2 = Element.Curves(select_model_elements)
flatten_3 = Flatten(curves_2)

# group: SPLIT EACH LINE USING ONLY THE POINTS THAT BELONG TO THAT LINE
flatten_4 = Flatten(curves_2)
intersectAll = Curve.IntersectAll(flatten_4)
doesIntersect_2 = Geometry.DoesIntersect(geometry=flatten_4, other=intersectAll, lacing=CrossProduct)
filterByBoolMask = List.FilterByBoolMask(list=intersectAll@@L2, mask=doesIntersect_2, lacing=Longest)
splitByPoints = Curve.SplitByPoints(curve=flatten_4, points=filterByBoolMask.in)

flatten_5 = Flatten(splitByPoints)
watch_23 = Watch(flatten_5)
code_block_25 = CodeBlock { 0; }
getItemAtIndex_8 = List.GetItemAtIndex(list=getParameterValueByName, index=code_block_25)
getItemAtIndex_9 = List.GetItemAtIndex(list=watch_3, index=code_block_25)
levels_2 = Levels("00")
code_block_26 = CodeBlock { 50; }
byLines = Custom[Pipe.ByLines](Lines=watch_23, PipeType=getItemAtIndex_8, SystemType=getItemAtIndex_9, Level=levels_2, Diameter=code_block_26)  # Creates a pipe by Line, PipeType, SystemType, Level and Diameter
watch_24 = Watch(intersectAll)
code_block_27 = CodeBlock { 10; }
byCenterPointRadius = Sphere.ByCenterPointRadius(centerPoint=watch_24, radius=code_block_27)
flatten_6 = Flatten(byCenterPointRadius)
count = Count(flatten_6)
ofRepeatedItem = List.OfRepeatedItem(item=byLines, amount=count)
watch_25 = Watch(ofRepeatedItem)
location = Custom[Element.Location](element=byLines)  # Returns the location of an element as an XYZ (or if it's line-based the start and end point of the line), along with some booleans to help filtering the results. Use this for some element types (e.g. walls or lines) that do not work with the built-in Get Family Instance Location node.
doesIntersect_3 = Geometry.DoesIntersect(geometry=flatten_6, other=location.curves, lacing=CrossProduct)
watch_26 = Watch(doesIntersect_3)
filterByBoolMask_2 = List.FilterByBoolMask(list=ofRepeatedItem, mask=watch_26)
watch_27 = Watch(filterByBoolMask_2.in)
count_2 = List.Count(watch_27, lacing=Longest)
watch_28 = Watch(count_2)
code_block_28 = CodeBlock { 4; }
eq = watch_28 == code_block_28
filterByBoolMask_3 = List.FilterByBoolMask(list=watch_27, mask=eq)
watch_29 = Watch(filterByBoolMask_3.in)
count_3 = Count(watch_27)
code_block_29 = CodeBlock(a=count_3) { a*4; }

# group: Crosses
flatten_7 = Flatten(watch_29)
code_block_30 = CodeBlock(a=code_block_29) { 0..a..4; 1..a..4; 2..a..4; 3..a..4; }
getItemAtIndex_10 = List.GetItemAtIndex(list=flatten_7, index=code_block_30.out0)
removeNulls = Lists.Manage.RemoveNulls(getItemAtIndex_10)
watch_30 = Watch(removeNulls)
getItemAtIndex_11 = List.GetItemAtIndex(list=flatten_7, index=code_block_30.out1)
removeNulls_2 = Lists.Manage.RemoveNulls(getItemAtIndex_11)
watch_31 = Watch(removeNulls_2)
getItemAtIndex_12 = List.GetItemAtIndex(list=flatten_7, index=code_block_30.out2)
removeNulls_3 = Lists.Manage.RemoveNulls(getItemAtIndex_12)
watch_32 = Watch(removeNulls_3)
getItemAtIndex_13 = List.GetItemAtIndex(list=flatten_7, index=code_block_30.out3)
removeNulls_4 = Lists.Manage.RemoveNulls(getItemAtIndex_13)
watch_33 = Watch(removeNulls_4)
python_script_3 = Python(IN[0]=watch_30, IN[1]=watch_31, IN[2]=watch_32, IN[3]=watch_33)
# ---------- python_script_3.python (79 lines) ----------
import clr

clr.AddReference("RevitServices")
import RevitServices
from RevitServices.Persistence import DocumentManager
from RevitServices.Transactions import TransactionManager
doc = DocumentManager.Instance.CurrentDBDocument

clr.AddReference("RevitAPI")
from Autodesk.Revit.DB import *

clr.AddReference("RevitNodes")
import Revit
clr.ImportExtensions(Revit.Elements)
clr.ImportExtensions(Revit.GeometryConversion)

if isinstance(IN[0], list):
	pipe1 = UnwrapElement(IN[0])
else:
	pipe1 = [UnwrapElement(IN[0])]
if isinstance(IN[1], list):
	pipe2 = UnwrapElement(IN[1])
else:
	pipe2 = [UnwrapElement(IN[1])]
if isinstance(IN[2], list):
	pipe3 = UnwrapElement(IN[2])
else:
	pipe3 = [UnwrapElement(IN[2])]
if isinstance(IN[3], list):
	pipe4 = UnwrapElement(IN[3])
else:
	pipe4 = [UnwrapElement(IN[3])]

def closest_connectors(pipe1, pipe2,pipe3, pipe4):
	conn1 = pipe1.ConnectorManager.Connectors
	conn2 = pipe2.ConnectorManager.Connectors
	conn3 = pipe3.ConnectorManager.Connectors
	conn4 = pipe4.ConnectorManager.Connectors
	
	dist1 = 100000000
	dist2 = 100000000
	dist3 = 100000000
	connset = []
	for c in conn1:
		for d in conn2:
			conndist = c.Origin.DistanceTo(d.Origin)
			if conndist < dist1:
				dist1 = conndist
				c1 = c
				d1 = d
		for e in conn3:
			conndist = c.Origin.DistanceTo(e.Origin)
			if conndist < dist2:
				dist2 = conndist
				e1 = e
		for f in conn4:
			conndist = c.Origin.DistanceTo(f.Origin)
			if conndist < dist3:
				dist3 = conndist
				f1 = f
		connset = [c1,d1,e1,f1]
	return connset

	
fittings = []
TransactionManager.Instance.EnsureInTransaction(doc)
for p1,p2,p3,p4 in zip(pipe1,pipe2,pipe3,pipe4):
	connectors = closest_connectors(p1,p2,p3,p4)
	try:
		fitting = doc.Create.NewCrossFitting(connectors[0],connectors[1],connectors[2],connectors[3])
		fittings.append(fitting.ToDSType(False))
	except:
		fittings.append(None)
		
TransactionManager.Instance.TransactionTaskDone()

			

OUT = fittings
# ----------------------------------------
watch_34 = Watch(python_script_3)

code_block_31 = CodeBlock { 2; }
eq_2 = watch_28 == code_block_31
filterByBoolMask_4 = List.FilterByBoolMask(list=watch_27, mask=eq_2)
watch_35 = Watch(filterByBoolMask_4.in)

# group: Elbow
flatten_8 = Flatten(watch_35)
code_block_32 = CodeBlock { 1000; }
byMEPCurves = Custom[Elbow.ByMEPCurves](MEPCurves=flatten_8, Margin=code_block_32)  # Takes in a list of MEPCurves (pipe, duct, cable tray, conduit) and will attempt to create elbows where possible. A margin can be entered for max distance between connectors
watch_36 = Watch(byMEPCurves)

code_block_33 = CodeBlock { 3; }
eq_3 = watch_28 == code_block_33
filterByBoolMask_5 = List.FilterByBoolMask(list=watch_27, mask=eq_3)
watch_37 = Watch(filterByBoolMask_5.in)

# group: Tee
flatten_9 = Flatten(watch_37)
code_block_34 = CodeBlock(a=code_block_29) { 0..a..3; 1..a..3; 2..a..3; }
getItemAtIndex_14 = List.GetItemAtIndex(list=flatten_9, index=code_block_34.out1)
removeNulls_5 = Lists.Manage.RemoveNulls(getItemAtIndex_14)
flatten_10 = Flatten(removeNulls_5)
watch_38 = Watch(flatten_10)
getItemAtIndex_15 = List.GetItemAtIndex(list=flatten_9, index=code_block_34.out2)
removeNulls_6 = Lists.Manage.RemoveNulls(getItemAtIndex_15)
flatten_11 = Flatten(removeNulls_6)
watch_39 = Watch(flatten_11)
getItemAtIndex_16 = List.GetItemAtIndex(list=flatten_9, index=code_block_34.out0)
removeNulls_7 = Lists.Manage.RemoveNulls(getItemAtIndex_16)
flatten_12 = Flatten(removeNulls_7)
watch_40 = Watch(flatten_12)
byMEPCurves_2 = Custom[Tee.By3MEPCurves](MEPCurve1=watch_38, MEPCurve2=watch_39, MEPCurve3=watch_40)  # "Tee.ByMEPCurves"; Creates a new Tee fitting for the 3 input MEP curves (conduit, cable tray, duct or pipe). Only works with a perpendicular branch MEPCurve
watch_41 = Watch(byMEPCurves_2)
watch_42 = Watch(getItemAtIndex_15)
watch_43 = Watch(code_block_34.out2)

watch_44 = Watch()  # unwired: arg0
watch_45 = Watch(location.curveEndpoints)
create_3 = List.Create(watch_35, watch_37, watch_29)
flatten_13 = Flatten(create_3)
location_2 = Custom[Element.Location](element=flatten_13)
watch_46 = Watch(location_2.curveEndpoints)
watch_47 = Watch(byLines)
select_in_revit = Custom[Select in Revit](Element=watch_47)  # Select Elements in Revit
