# Dynamo graph Detail_Lines_To_Pipes_Geometry2312.dyn (Dynamo 1.3.0.875)

select_model_elements = DSModelElementsSelection()  # 11 picked in the model
curves = Element.Curves(select_model_elements)
flatten = Flatten(curves)
intersectAll = Curve.IntersectAll(flatten)
doesIntersect = Geometry.DoesIntersect(geometry=flatten, other=intersectAll, lacing=CrossProduct)
filterByBoolMask = List.FilterByBoolMask(list=intersectAll@@L2, mask=doesIntersect, lacing=Longest)
splitByPoints = Curve.SplitByPoints(curve=flatten, points=filterByBoolMask.in)
flatten_2 = Flatten()  # unwired: arg0
intersectAll_2 = Curve.IntersectAll(flatten_2)
code_block = CodeBlock { {0,1}; }
pointAtParameter = Curve.PointAtParameter(param=code_block, lacing=CrossProduct)  # unwired: curve
distanceTo = Geometry.DistanceTo(geometry=intersectAll_2, other=pointAtParameter, lacing=CrossProduct)
code_block_2 = CodeBlock(a=distanceTo) { a==0; }
countTrue = CountTrue(code_block_2, lacing=Longest)
watch = Watch(countTrue)
flatten_3 = Flatten()  # unwired: arg0
uniqueItems = List.UniqueItems(flatten_3)
watch_2 = Watch(uniqueItems)
watch_3 = Watch(intersectAll_2)
code_block_3 = CodeBlock { 10; }
byCenterPointRadius = Sphere.ByCenterPointRadius(centerPoint=watch_3, radius=code_block_3)
flatten_4 = Flatten(byCenterPointRadius)
count = Count(flatten_4)
ofRepeatedItem = List.OfRepeatedItem(item=flatten_2, amount=count)
doesIntersect_2 = Geometry.DoesIntersect(geometry=flatten_4, other=flatten_2, lacing=CrossProduct)
watch_4 = Watch(doesIntersect_2)
filterByBoolMask_2 = List.FilterByBoolMask(list=ofRepeatedItem, mask=watch_4)
code_block_4 = CodeBlock(a=filterByBoolMask_2.in) { a; }
parameterAtPoint = Curve.ParameterAtPoint(curve=code_block_4, point=intersectAll_2)
round_precision_code_block = CodeBlock { 5; }
python_script = Python(IN[0]=parameterAtPoint, IN[1]=round_precision_code_block)
# ---------- python_script.python (26 lines) ----------
import clr
clr.AddReference('ProtoGeometry')
from Autodesk.DesignScript.Geometry import *

#Parameter to split curve (it's a double)
par = IN[0]

#Precision to be used
precision = IN[1]

#Index of parameter to be used
indexPar = []
purged = []

for i in range(0,len(par)):
	p = []
	ind = []
	purged.append(p)
	indexPar.append(ind)
	for j in range(0,len(par[i])):
		if round(par[i][j],precision)!=0 and round(par[i][j],precision)<1:
			p.append(round(par[i][j],precision))
			ind.append(par[i].index(par[i][j]))

#Assign your output to the OUT variable.
OUT = indexPar
# ----------------------------------------

# group: curves to be split
getItemAtIndex = List.GetItemAtIndex(list=code_block_4, index=python_script, lacing=Longest)

# group: points to be used
getItemAtIndex_2 = List.GetItemAtIndex(list=parameterAtPoint, index=python_script, lacing=Longest)

splitByParameter = Curve.SplitByParameter(getItemAtIndex, getItemAtIndex_2)
flatten_5 = Flatten(splitByParameter)

# group: DataShapes UI Inputs
categories = Categories("PipeCurves")
all_elements_of_category = ElementsOfCategory(categories)
code_block_5 = CodeBlock { "Type"; }
getParameterValueByName = Element.GetParameterValueByName(element=all_elements_of_category, parameterName=code_block_5)
categories_2 = Categories("PipingSystem")
all_elements_of_category_2 = ElementsOfCategory(categories_2)
code_block_6 = CodeBlock { "Type"; }
getParameterValueByName_2 = Element.GetParameterValueByName(element=all_elements_of_category_2, parameterName=code_block_6)
uniqueItems_2 = List.UniqueItems(getParameterValueByName_2)
watch_5 = Watch(uniqueItems_2)

code_block_7 = CodeBlock { 1; }
getItemAtIndex_3 = List.GetItemAtIndex(list=getParameterValueByName, index=code_block_7)
getItemAtIndex_4 = List.GetItemAtIndex(list=watch_5, index=code_block_7)
levels = Levels()
code_block_8 = CodeBlock { 50; }
byLines = Custom[Pipe.ByLines](Lines=flatten_5, PipeType=getItemAtIndex_3, SystemType=getItemAtIndex_4, Level=levels, Diameter=code_block_8)  # Creates a pipe by Line, PipeType, SystemType, Level and Diameter
location = Custom[Element.Location](element=byLines)  # Returns the location of an element as an XYZ (or if it's line-based the start and end point of the line), along with some booleans to help filtering the results. Use this for some element types (e.g. walls or lines) that do not work with the built-in Get Family Instance Location node.
watch_6 = Watch(ofRepeatedItem)
watch_7 = Watch()  # unwired: arg0
count_2 = List.Count(watch_7, lacing=Longest)
watch_8 = Watch(count_2)
code_block_9 = CodeBlock { 4; }
eq = watch_8 == code_block_9
filterByBoolMask_3 = List.FilterByBoolMask(list=watch_7, mask=eq)
watch_9 = Watch(filterByBoolMask_3.in)
count_3 = Count(watch_7)
code_block_10 = CodeBlock(a=count_3) { a*4; }

# group: Crosses
flatten_6 = Flatten(watch_9)
code_block_11 = CodeBlock(a=code_block_10) { 0..a..4; 1..a..4; 2..a..4; 3..a..4; }
getItemAtIndex_5 = List.GetItemAtIndex(list=flatten_6, index=code_block_11.out0)
removeNulls = Lists.Manage.RemoveNulls(getItemAtIndex_5)
watch_10 = Watch(removeNulls)
getItemAtIndex_6 = List.GetItemAtIndex(list=flatten_6, index=code_block_11.out1)
removeNulls_2 = Lists.Manage.RemoveNulls(getItemAtIndex_6)
watch_11 = Watch(removeNulls_2)
getItemAtIndex_7 = List.GetItemAtIndex(list=flatten_6, index=code_block_11.out2)
removeNulls_3 = Lists.Manage.RemoveNulls(getItemAtIndex_7)
watch_12 = Watch(removeNulls_3)
getItemAtIndex_8 = List.GetItemAtIndex(list=flatten_6, index=code_block_11.out3)
removeNulls_4 = Lists.Manage.RemoveNulls(getItemAtIndex_8)
watch_13 = Watch(removeNulls_4)
python_script_2 = Python(IN[0]=watch_10, IN[1]=watch_11, IN[2]=watch_12, IN[3]=watch_13)
# ---------- python_script_2.python (79 lines) ----------
import clr

clr.AddReference("RevitServices")
import RevitServices
from RevitServices.Persistence import DocumentManager
from RevitServices.Transactions import TransactionManager
doc = DocumentManager.Instance.CurrentDBDocument

clr.AddReference("RevitAPI")
from Autodesk.Revit.DB import *

clr.AddReference("RevitNodes")
import Revit
clr.ImportExtensions(Revit.Elements)
clr.ImportExtensions(Revit.GeometryConversion)

if isinstance(IN[0], list):
	pipe1 = UnwrapElement(IN[0])
else:
	pipe1 = [UnwrapElement(IN[0])]
if isinstance(IN[1], list):
	pipe2 = UnwrapElement(IN[1])
else:
	pipe2 = [UnwrapElement(IN[1])]
if isinstance(IN[2], list):
	pipe3 = UnwrapElement(IN[2])
else:
	pipe3 = [UnwrapElement(IN[2])]
if isinstance(IN[3], list):
	pipe4 = UnwrapElement(IN[3])
else:
	pipe4 = [UnwrapElement(IN[3])]

def closest_connectors(pipe1, pipe2,pipe3, pipe4):
	conn1 = pipe1.ConnectorManager.Connectors
	conn2 = pipe2.ConnectorManager.Connectors
	conn3 = pipe3.ConnectorManager.Connectors
	conn4 = pipe4.ConnectorManager.Connectors
	
	dist1 = 100000000
	dist2 = 100000000
	dist3 = 100000000
	connset = []
	for c in conn1:
		for d in conn2:
			conndist = c.Origin.DistanceTo(d.Origin)
			if conndist < dist1:
				dist1 = conndist
				c1 = c
				d1 = d
		for e in conn3:
			conndist = c.Origin.DistanceTo(e.Origin)
			if conndist < dist2:
				dist2 = conndist
				e1 = e
		for f in conn4:
			conndist = c.Origin.DistanceTo(f.Origin)
			if conndist < dist3:
				dist3 = conndist
				f1 = f
		connset = [c1,d1,e1,f1]
	return connset

	
fittings = []
TransactionManager.Instance.EnsureInTransaction(doc)
for p1,p2,p3,p4 in zip(pipe1,pipe2,pipe3,pipe4):
	connectors = closest_connectors(p1,p2,p3,p4)
	try:
		fitting = doc.Create.NewCrossFitting(connectors[0],connectors[1],connectors[2],connectors[3])
		fittings.append(fitting.ToDSType(False))
	except:
		fittings.append(None)
		
TransactionManager.Instance.TransactionTaskDone()

			

OUT = fittings
# ----------------------------------------
watch_14 = Watch(python_script_2)

code_block_12 = CodeBlock { 2; }
eq_2 = watch_8 == code_block_12
filterByBoolMask_4 = List.FilterByBoolMask(list=watch_7, mask=eq_2)
watch_15 = Watch(filterByBoolMask_4.in)

# group: Elbow
flatten_7 = Flatten(watch_15)
code_block_13 = CodeBlock { 1000; }
byMEPCurves = Custom[Elbow.ByMEPCurves](MEPCurves=flatten_7, Margin=code_block_13)  # Takes in a list of MEPCurves (pipe, duct, cable tray, conduit) and will attempt to create elbows where possible. A margin can be entered for max distance between connectors
watch_16 = Watch(byMEPCurves)

code_block_14 = CodeBlock { 3; }
eq_3 = watch_8 == code_block_14
filterByBoolMask_5 = List.FilterByBoolMask(list=watch_7, mask=eq_3)
watch_17 = Watch(filterByBoolMask_5.in)

# group: Tee
flatten_8 = Flatten(watch_17)
code_block_15 = CodeBlock(a=code_block_10) { 0..a..3; 1..a..3; 2..a..3; }
getItemAtIndex_9 = List.GetItemAtIndex(list=flatten_8, index=code_block_15.out1)
removeNulls_5 = Lists.Manage.RemoveNulls(getItemAtIndex_9)
flatten_9 = Flatten(removeNulls_5)
watch_18 = Watch(flatten_9)
getItemAtIndex_10 = List.GetItemAtIndex(list=flatten_8, index=code_block_15.out2)
removeNulls_6 = Lists.Manage.RemoveNulls(getItemAtIndex_10)
flatten_10 = Flatten(removeNulls_6)
watch_19 = Watch(flatten_10)
getItemAtIndex_11 = List.GetItemAtIndex(list=flatten_8, index=code_block_15.out0)
removeNulls_7 = Lists.Manage.RemoveNulls(getItemAtIndex_11)
flatten_11 = Flatten(removeNulls_7)
watch_20 = Watch(flatten_11)
byMEPCurves_2 = Custom[Tee.By3MEPCurves](MEPCurve1=watch_18, MEPCurve2=watch_19, MEPCurve3=watch_20)  # "Tee.ByMEPCurves"; Creates a new Tee fitting for the 3 input MEP curves (conduit, cable tray, duct or pipe). Only works with a perpendicular branch MEPCurve
watch_21 = Watch(byMEPCurves_2)
watch_22 = Watch(getItemAtIndex_10)
watch_23 = Watch(code_block_15.out2)

code_block_16 = CodeBlock { HERE SP:ITS!??£!"£ }
flatten_12 = Flatten()  # unwired: arg0
length = Curve.Length(flatten_12)
removeNulls_8 = Lists.Manage.RemoveNulls(length)
removeItemAtIndex = List.RemoveItemAtIndex(list=flatten_12, indices=removeNulls_8.out1)
code_block_17 = CodeBlock(a=removeNulls_8.out0) { a>1; }
filterByBoolMask_6 = List.FilterByBoolMask(list=removeItemAtIndex, mask=code_block_17)
code_block_18 = CodeBlock(a=filterByBoolMask_6.in) { a; }
doesIntersect_3 = Geometry.DoesIntersect(geometry=flatten_4, other=flatten_5, lacing=CrossProduct)
