# Dynamo graph Elements in Room - Multilink and Multicategory v2.dyn (Dynamo 0.8.2.2371)

# group: Get Family Instances from Link by Wildcard Link Name Search
get_linked_rvt_documents = Custom[Get Linked RVT Documents]()
string = StringInput("RAH_BAS_WF")
filter_one_list_by_string_search = Custom[Filter One List by String Search in Another List](SearchThisList=get_linked_rvt_documents.Link_Name, searchFor=string, FilterThisList=get_linked_rvt_documents.Link_Doc)
bv_remove_nulls = Custom[bv Remove Nulls](List=filter_one_list_by_string_search.Matching)  # forked from Lunchbox
get_all_family_instances_from = Custom[Get All Family Instances From Link Doc]()
map = List.Map(list=bv_remove_nulls, f_x=get_all_family_instances_from)

flatten = Flatten(map)
watch = Watch(flatten)

# group: Wildcard Search Revit Link names and Get Rooms
code_block = CodeBlock { "AR"; }
code_block_2 = CodeBlock { "Rooms"; }
convert_category_name_to_built = Custom[Convert Category Name to Built In Category Name](categoryName=code_block_2)  # You must use List.Map to convert list of Category Names to list of Built In Names
get_elements_in_link_using_name = Custom[Get Elements in Link using Name Search and Category](SearchLinkNames=code_block, DesiredCategoryBuiltInName=convert_category_name_to_built)  # link name search

watch_2 = Watch(get_elements_in_link_using_name.ElementsFlatList)

# group: Get Rooms and Room / Element parameters
code_block_3 = CodeBlock { "Name"; }
code_block_4 = CodeBlock { "Number"; }
code_block_5 = CodeBlock { "Mark"; }
code_block_6 = CodeBlock { "Comments"; }
collect_elements_in_rooms_and = Custom[Collect Elements in Rooms and Show Detailed List](Elements=watch, Rooms=watch_2, RoomParameterOne=code_block_3, RoomParameterTwo=code_block_4, ElementParameterOne=code_block_5, ElementParameterTwo=code_block_6)  # Allows you to generate various lists of elements in rooms. Can get two parameters for Rooms, and two for Elements. Based on Family.InRoom work by Konrad, which was built on others.

# group: Out to Excel
file_path = Filename("E:\temp\tempexp.xlsx")
string_2 = StringInput("data")
code_block_7 = CodeBlock { 0; }
code_block_8 = CodeBlock { true; }
writeToFile = Excel.WriteToFile(filePath=file_path, sheetName=string_2, startRow=code_block_7, startCol=code_block_7, data=collect_elements_in_rooms_and.DetailedCombinedListForExcel, overWrite=code_block_8)

# group: Type Information
get_linked_element_type_from = Custom[Get Linked Element Type from Mapped doc element lists](mapped_element_list_divided_by_doc=map, list_of_link_docs=bv_remove_nulls)
watch_3 = Watch(get_linked_element_type_from)

# group: Get Type for Elements in Rooms
code_block_9 = CodeBlock { "Type Id"; }
code_block_10 = CodeBlock { "no type found"; }
bruteforce_get_parameter_value = Custom[Bruteforce Get Parameter Value by Name](element_or_elements=collect_elements_in_rooms_and.ElementsInRooms, parameterName=code_block_9, replaceEmptyValueWith=code_block_10)  # If Element.Parameters shows a value, this node will search for it and return the value or an optional empty value replacement.
bv_elements_to_ids = Custom[bv Elements to IDs](Element_s=watch_3)  # forked from CAAD_RWTH
flat_list_to_list_of_strings = Custom[Flat List to List of Strings](Original_List=bv_elements_to_ids.ID_s)  # using python methods
watch_4 = Watch(flat_list_to_list_of_strings)
if_equal_return_index_using = Custom[If Equal Return Index using IndexOf](searchForThese=bruteforce_get_parameter_value.BruteForceValues, inThisList=watch_4)
getItemAtIndex = List.GetItemAtIndex(list=watch_3, index=if_equal_return_index_using)
