# Dynamo graph Home01.dyn (Dynamo 0.8.2.2392)

select_model_elements = DSModelElementsSelection()
code_block = CodeBlock(a=select_model_elements) { a[0]; }
code_block_2 = CodeBlock { "Load Name"; }
categories = Categories("Rooms")
all_elements_of_category = ElementsOfCategory(categories)
code_block_3 = CodeBlock { "Number"; }
getParameterValueByName = Element.GetParameterValueByName(element=all_elements_of_category, parameterName=code_block_3)
string_from_array = FromArray(getParameterValueByName)
code_block_4 = CodeBlock { "{"; }
code_block_5 = CodeBlock { "Room "; }
replace = String.Replace(str=string_from_array, searchFor=code_block_4, replaceWith=code_block_5)
code_block_6 = CodeBlock { "}"; }
code_block_7 = CodeBlock { " " + a; }
replace_2 = String.Replace(str=replace, searchFor=code_block_6, replaceWith=code_block_7)
setParameterByName = Element.SetParameterByName(parameterName=code_block_2, value=replace_2)
geometry = Element.Geometry(all_elements_of_category)
watch = Watch(all_elements_of_category)
watch_2 = Watch(select_model_elements)
parameters = Element.Parameters(watch_2)
element_types = ElementTypes("AnalysisDisplayLegend")
all_elements_of_type = ElementsOfType(element_types)
watch_3 = Watch(all_elements_of_type)
element_types_2 = ElementTypes("AnalysisDisplayLegend")
categories_2 = Categories("ElectricalFixtures")
all_elements_of_category_2 = ElementsOfCategory(categories_2)
watch_4 = Watch(all_elements_of_category_2)

# group: ELEMENT IN ROOM
python_script = Python()
# ---------- python_script.python (45 lines) ----------
import clr
# Import RevitAPI
clr.AddReference("RevitAPI")
import Autodesk
from Autodesk.Revit.DB import *

# Import DocumentManager and TransactionManager
clr.AddReference("RevitServices")
import RevitServices
from RevitServices.Persistence import DocumentManager
from RevitServices.Transactions import TransactionManager

# Import ToDSType(bool) extension method
clr.AddReference("RevitNodes")
import Revit
clr.ImportExtensions(Revit.Elements)

# Start Transaction
doc = DocumentManager.Instance.CurrentDBDocument
TransactionManager.Instance.EnsureInTransaction(doc)

#Declare list variables
Room = []
elements = []

#unwrap inputs
for i in IN[0]:
	elements.append(UnwrapElement(i))

#List the "Room" for all phases
for i in elements:
	for phase in doc.Phases:
		if i.CreatedPhaseId == phase.Id:
			try:
				room = i.Room[phase]
				Room.append(room)
			except:
				Room.append(None)
				continue			

# End Transaction
TransactionManager.Instance.TransactionTaskDone()

#Assign your output to the OUT variable
OUT = Room
# ----------------------------------------

categories_3 = Categories("Rooms")
all_elements_of_category_3 = ElementsOfCategory(categories_3)
watch_5 = Watch(all_elements_of_category_3)
code_block_8 = CodeBlock { "Panel"; }
getParameterValueByName_2 = Element.GetParameterValueByName(element=all_elements_of_category_2, parameterName=code_block_8)

# group: CIRCUITS
code_block_9 = CodeBlock { "PP74"; }
code_block_10 = CodeBlock { 1; }
element_types_3 = ElementTypes("ElectricalSystem")
all_elements_of_type_2 = ElementsOfType(element_types_3)
code_block_11 = CodeBlock { "Panel"; }
getParameterValueByName_3 = Element.GetParameterValueByName(element=all_elements_of_type_2, parameterName=code_block_11)
contains = String.Contains(str=getParameterValueByName_3, searchFor=code_block_9, ignoreCase=code_block_10)
filterByBoolMask = List.FilterByBoolMask(list=all_elements_of_type_2, mask=contains)
code_block_12 = CodeBlock { "Circuit Number"; }
getParameterValueByName_4 = Element.GetParameterValueByName(element=filterByBoolMask.in, parameterName=code_block_12)

contains_2 = String.Contains(str=getParameterValueByName_2, searchFor=code_block_9, ignoreCase=code_block_10)
filterByBoolMask_2 = List.FilterByBoolMask(list=all_elements_of_category_2, mask=contains_2)
code_block_13 = CodeBlock { "Circuit Number"; }
getParameterValueByName_5 = Element.GetParameterValueByName(element=filterByBoolMask_2.in, parameterName=code_block_13)
contains_3 = String.Contains(str=getParameterValueByName_5, searchFor=getParameterValueByName_4, lacing=CrossProduct)
transpose = List.Transpose(contains_3)
code_block_14 = CodeBlock { true; }
containsItem = List.ContainsItem(item=code_block_14, lacing=Longest)
map = List.Map(f_x=containsItem)
map_2 = List.Map(list=transpose, f_x=map)
filterByBoolMask_3 = List.FilterByBoolMask()
create = List.Create(getParameterValueByName_5)
code_block_15 = CodeBlock(a=getParameterValueByName_4) { List.Count(a); }
cycle = List.Cycle(list=create, amount=code_block_15)
eq = getParameterValueByName_4 == getParameterValueByName_5  # lacing=CrossProduct
boolean = BoolSelector(true)
boolean_2 = BoolSelector(false)
if_ = If(test=eq, true=boolean, false=boolean_2)
combine = List.Combine(filterByBoolMask_3.in, cycle, if_)
