# Dynamo graph Home03.dyn (Dynamo 1.2.0.2514)

file_path = Filename(".\Test.xlsx")
code_block = CodeBlock { "Room"; }
code_block_2 = CodeBlock { 0; }
collect_all_familyinstance_using = Custom[Collect all FamilyInstance using Element Types]()  # should get model family instances
get_documents = Custom[Get Documents]()  # Queries all linked Revit files and retrieves their Name, LinkInstance and Document properties.
watch = Watch(get_documents.Link_Doc)
firstItem = List.FirstItem(watch)
categories = Categories("Rooms")
get_all_elements_from_linked = Custom[Get All Elements From Linked Model](LinkDoc=firstItem, Category=categories)  # This node is based on code posted by Julien Benoit. Big thanks to Julien for sharing his work. This node will retrieve all elements of a given category from a given linked model.
code_block_3 = CodeBlock { "Name"; }
code_block_4 = CodeBlock { "Number"; }
code_block_5 = CodeBlock { "Type"; }
code_block_6 = CodeBlock { "Comments"; }
collect_elements_in_rooms_and = Custom[Collect Elements in Rooms and Show Detailed List](Elements=collect_all_familyinstance_using, Rooms=get_all_elements_from_linked, RoomParameterOne=code_block_3, RoomParameterTwo=code_block_4, ElementParameterOne=code_block_5, ElementParameterTwo=code_block_6)  # Allows you to generate various lists of elements in rooms. Can get two parameters for Rooms, and two for Elements. Based on Family.InRoom work by Konrad, which was built on others.
create = List.Create(collect_elements_in_rooms_and.RoomParameterOne, collect_elements_in_rooms_and.RoomParameterTwo, collect_elements_in_rooms_and.ElementIds, collect_elements_in_rooms_and.ElementParameterOne)
transpose = List.Transpose(create)
code_block_7 = CodeBlock { 0; }
writeToFile = Excel.WriteToFile(filePath=file_path, sheetName=code_block, startRow=code_block_2, startCol=code_block_2, data=transpose, overWrite=code_block_7)
python_script = Python(IN[0]=collect_all_familyinstance_using, IN[1]=get_all_elements_from_linked)
# ---------- python_script.python (53 lines) ----------
#Copyright(c) 2015, Konrad Sobon
# @arch_laboratory, http://archi-lab.net

# This code is based on Family.InRoom node originally created
# by Peter Kompolschek and published on Dynamo blog. Big thanks 
# to Peter for sharing his work so graciously.

import clr
clr.AddReference('ProtoGeometry')
from Autodesk.DesignScript.Geometry import *

# Import DocumentManager and TransactionManager
clr.AddReference("RevitServices")
import RevitServices
from RevitServices.Persistence import DocumentManager
from RevitServices.Transactions import TransactionManager

# Import RevitAPI
clr.AddReference("RevitAPI")
import Autodesk
from Autodesk.Revit.DB import *

doc = DocumentManager.Instance.CurrentDBDocument
uiapp = DocumentManager.Instance.CurrentUIApplication
app = uiapp.Application

from System.Collections.Generic import *

#The inputs to this node will be stored as a list in the IN variable.
def FamiliesInRoom(_room, _families):
	outList = []
	for family in _families:
		try:
			pt = family.Location.Point
		except:
			pt = family.Location.Curve.Origin
		if _room.IsPointInRoom(pt):
			outList.append(family)
	return outList

families = []
for i in IN[0]:
	families.append(UnwrapElement(i))

rooms = []
for i in IN[1]:
	rooms.append(UnwrapElement(i))

outData = [[] for i in range(len(rooms))]
for index, room in enumerate(rooms):
	outData[index].extend(FamiliesInRoom(room, families))

OUT = outData
# ----------------------------------------
