# Dynamo graph Linked Room Exercise v2.dyn (Dynamo 1.2.0.2514)

collect_all_familyinstance_using = Custom[Collect all FamilyInstance using Element Types]()  # should get model family instances
get_linked_rvt_documents = Custom[Get Linked RVT Documents]()
code_block = CodeBlock(a=get_linked_rvt_documents.Link_Doc) { a[0]; }
categories = Categories("Rooms")
python_script = Python(IN[0]=code_block, IN[1]=categories)
# ---------- python_script.python (42 lines) ----------
#Copyright(c) 2015, Konrad Sobon
# @arch_laboratory, http://archi-lab.net

# This node is based on Julien Benoit's Element.GetElementFromLinkedFile 
# node. Some slight improvements were made removing unnecessary imports/references.
# Big thank you to Julien for sharing his work. 

import clr
clr.AddReference('ProtoGeometry')
from Autodesk.DesignScript.Geometry import *

# Import RevitAPI
clr.AddReference("RevitAPI")
import Autodesk
from Autodesk.Revit.DB import *

import System

import sys
pyt_path = r'C:\Program Files (x86)\IronPython 2.7\Lib'
sys.path.append(pyt_path)

#The inputs to this node will be stored as a list in the IN variable.
dataEnteringNode = IN

_linkDoc = IN[0]
_category = IN[1]

try:
	errorReport = None
	filter = ElementCategoryFilter(System.Enum.ToObject(BuiltInCategory, _category.Id))
	result = FilteredElementCollector(_linkDoc).WherePasses(filter).WhereElementIsNotElementType().ToElements()
except:
	# if error accurs anywhere in the process catch it
	import traceback
	errorReport = traceback.format_exc()

#Assign your output to the OUT variable
if errorReport == None:
	OUT = result
else:
	OUT = errorReport
# ----------------------------------------
code_block_2 = CodeBlock { "Name"; }
code_block_3 = CodeBlock { "Number"; }
code_block_4 = CodeBlock { "Mark"; }
code_block_5 = CodeBlock { "Comments"; }
collect_elements_in_rooms_and = Custom[Collect Elements in Rooms and Show Detailed List](Elements=collect_all_familyinstance_using, Rooms=python_script, RoomParameterOne=code_block_2, RoomParameterTwo=code_block_3, ElementParameterOne=code_block_4, ElementParameterTwo=code_block_5)  # Allows you to generate various lists of elements in rooms. Can get two parameters for Rooms, and two for Elements. Based on Family.InRoom work by Konrad, which was built on others.
watch = Watch(collect_elements_in_rooms_and.RoomParameterTwo)
watch_2 = Watch(collect_elements_in_rooms_and.ElementParameterOne)
