# Dynamo graph NCH_PH_Revit Equipment to Excel.dyn (Dynamo 1.2.1.3083)

# group: Elements Selected and Working Parameters
sets_airflow_type_no_need_to = CodeBlock()  # "Sets Airflow Type (No Need to Edit)"
# ---------- sets_airflow_type_no_need_to.designscript (10 lines) ----------
"Defines Active System Type in Revit:";
def SystemClass()
{
return="Supply Air";
};
"Defines Space parameter to write to Air Terminal:";
def AirFlowType()
{
return="NPH_Specified_Outside_Air_Flow";
};
# ----------------------------------------
categories = Categories("MEPSpaces")
all_elements_of_category = ElementsOfCategory(categories)

# group: User input of Level
# note: Levels in NCH:
# B03
# B02
# B01
# L-1 (Lr Ground)
# L00 (Ground)
# L01
# L02
# L03
# L04
# L05
# L06
# L07
set_desired_level = CodeBlock()
# ---------- set_desired_level.designscript (5 lines) ----------
"Defines Level:";
def Activelevel()
{
return="L01";
};
# ----------------------------------------

# group: Collects all Space from the Link Spaces Model
get_documents = Custom[Get Documents]()  # Queries all linked Revit files and retrieves their Name, LinkInstance and Document properties.
string = StringInput("Equipment")
containsThisAndThat = Custom[String.ContainsThisAndThat](String=get_documents.Link_Name, SearchFor=string)  # Returns true and false based on whether the string contains all the inputs (multiple input as list)
filterByBoolMask = List.FilterByBoolMask(list=get_documents.Link_Instance, mask=containsThisAndThat)
categories_2 = Categories("GenericModel")
linkedInstanceElements = Custom[Springs.Collector.LinkedInstanceElements](link_instance_s=filterByBoolMask.in, category=categories_2)  # Extract elements by category from the selected linked instances. The transform vector can be used to get the exact location of the elements in the local file

# group: Filters Mechanical Equipment by Level
active_level = CodeBlock { "Host"; Activelevel(); }
getParameterValueByName = Element.GetParameterValueByName(element=linkedInstanceElements.elements, parameterName=active_level.out0)
contains = String.Contains(str=getParameterValueByName, searchFor=active_level.out1)
filterByBoolMask_2 = List.FilterByBoolMask(list=linkedInstanceElements.elements, mask=contains)

# group: Filters Generic Equipment by Comment of PH
active_level_2 = CodeBlock { "Comments"; "PH"; }
getParameterValueByName_2 = Element.GetParameterValueByName(element=filterByBoolMask_2.in, parameterName=active_level_2.out0)
string_from_object = FromObject(getParameterValueByName_2)
contains_2 = String.Contains(str=string_from_object, searchFor=active_level_2.out1)
filterByBoolMask_3 = List.FilterByBoolMask(list=filterByBoolMask_2.in, mask=contains_2)

getLocation = Element.GetLocation(filterByBoolMask_3.in)
transform = Geometry.Transform(getLocation, linkedInstanceElements.transform_s)

# group: Filters Spaces by Level
active_level_3 = CodeBlock { "Level"; Activelevel(); }
getParameterValueByName_3 = Element.GetParameterValueByName(element=all_elements_of_category, parameterName=active_level_3.out0)
contains_3 = String.Contains(str=getParameterValueByName_3, searchFor=active_level_3.out1)
filterByBoolMask_4 = List.FilterByBoolMask(list=all_elements_of_category, mask=contains_3)

# group: Looks for all Fan Coil Units located in each space. List Map counts the number of Fan Coil Units in each space
elements_in_space = Custom[Elements in Space](Element=transform, Space=filterByBoolMask_4.in)  # This node will take an input of Spaces and Elements and attempt to group all elements by Room that it is located in. For elements that are placed by Line and not a Point, a mid point of line will be used to determine location.
flatten = Flatten(elements_in_space)
count = Count()  # unwired: arg0
map = List.Map(list=elements_in_space, f_x=count)

# group: Collects air flows stored in all spaces. Divides by number of FCU found in that space and lists out results.
code_block = CodeBlock { "Number"; }
getParameterValueByName_4 = Element.GetParameterValueByName(element=filterByBoolMask_4.in, parameterName=code_block)
ofRepeatedItem = List.OfRepeatedItem(item=getParameterValueByName_4, amount=map, lacing=Longest)
flatten_2 = Flatten(ofRepeatedItem)

watch = Watch(elements_in_space)
getLocation_2 = Element.GetLocation(filterByBoolMask_4.in)
isPointInside = Custom[Space.IsPointInside](space=filterByBoolMask_4.in, point=transform)  # This will test if a point falls within a space.
code_block_2 = CodeBlock { true; }
allIndicesOf = List.AllIndicesOf(list=isPointInside, item=code_block_2, lacing=Longest)
getItemAtIndex = List.GetItemAtIndex(list=filterByBoolMask_4.in, index=allIndicesOf)
flatten_3 = Flatten(getItemAtIndex)
name = Element.Name(flatten_3)
countOccurences = Custom[List.CountOccurences](seq=name)  # Counts the number of occurences of each unique element in a given list
watch_2 = Watch(countOccurences.uniqueElements)
watch_3 = Watch(countOccurences.count)
