# Dynamo graph Pipes.dyn (Dynamo 1.2.3.592)

categories = Categories("PipeFitting")
all_elements_of_category = ElementsOfCategory(categories)
code_block = CodeBlock { "Size"; }
getParameterValueByName = Element.GetParameterValueByName(element=all_elements_of_category, parameterName=code_block)
mep_fitting_connected_mepcurves = Custom[MEP Fitting connected MEPCurves]()  # Returns the pipes, ducts, conduits or cable trays that are connected to the given fittings; unwired: Fittings
python_script = Python(IN[0]=all_elements_of_category)
# ---------- python_script.python (22 lines) ----------
import clr
clr.AddReference('ProtoGeometry')
from Autodesk.DesignScript.Geometry import *
#The inputs to this node will be stored as a list in the IN variables.
if isinstance(IN[0], list):
	fittings = UnwrapElement(IN[0])
else:
	fittings = [UnwrapElement(IN[0])]

refs = []

for x in fittings:
	connset = x.MEPModel.ConnectorManager.Connectors
	conn_pipes = []
	for c in connset:
		if c.IsConnected:
			for lc in c.AllRefs:
				conn_pipes.append(lc.Owner)
	refs.append(conn_pipes)

#Assign your output to the OUT variable.
OUT = refs
# ----------------------------------------
categories_2 = Categories("PipeCurves")
all_elements_of_category_2 = ElementsOfCategory(categories_2)
code_block_2 = CodeBlock { "Diameter"; }
getParameterValueByName_2 = Element.GetParameterValueByName(element=all_elements_of_category_2, parameterName=code_block_2)
convert_between_units = DynamoConvert(getParameterValueByName_2, conversionMetric=Length, conversionFrom=Feet, conversionTo=Meters)
