# Dynamo graph domestic_water_sizing.dyn (Dynamo 1.2.3.592)

string = StringInput("5psi/100")
sizing_chart = Python(IN[0]=string)
# ---------- sizing_chart.python (15 lines) ----------
import clr
clr.AddReference('ProtoGeometry')
from Autodesk.DesignScript.Geometry import *
#The inputs to this node will be stored as a list in the IN variables.
selection = IN

if selection == ["3psi/100"]:
	chart = [[3,20],[5,25],[10,32],[15,40],[75,50],[250,65],[700,75],[2300,100]]
elif selection == ['5psi/100']:
	chart = [[3,20],[5,25],[12,32],[25,40],[145,50],[500,65],[1100,75],[2800,100]]
else:
	chart ='[error]'

#Assign your output to the OUT variable.
OUT = chart
# ----------------------------------------
watch = Watch(sizing_chart)
string_2 = StringInput("3psi/100")
categories = Categories("PipeCurves")
all_elements_of_category = ElementsOfCategory(categories)
filter_by = StringInput("System Abbreviation")
getParameterValueByName = Element.GetParameterValueByName(element=all_elements_of_category, parameterName=filter_by)
system_abbreviation = StringInput("DCW")
eq = getParameterValueByName == system_abbreviation
filterByBoolMask = List.FilterByBoolMask(list=all_elements_of_category, mask=eq)
parameter_to_change = StringInput("Diameter")
getParameterValueByName_2 = Element.GetParameterValueByName(element=filterByBoolMask.in, parameterName=parameter_to_change)
watch_2 = Watch(getParameterValueByName_2)
parameter_to_monitor = StringInput("Fixture Units")
getParameterValueByName_3 = Element.GetParameterValueByName(element=filterByBoolMask.in, parameterName=parameter_to_monitor)
create = List.Create(getParameterValueByName_3, getParameterValueByName_2)
watch_3 = Watch(create)
chart_comparison = Python(IN[0]=sizing_chart, IN[1]=create)
# ---------- chart_comparison.python (25 lines) ----------
import clr
clr.AddReference('ProtoGeometry')
from Autodesk.DesignScript.Geometry import *
#The inputs to this node will be stored as a list in the IN variables.
size_chart=IN[0]
pipes = IN[1]

y=0
#print(len(size_chart))
for x in range (0,len(pipes[0])):
#    print("x is " + str(x))
    while y < len(size_chart):
#            print("y is " + str(y))
            if pipes[0][x] <= size_chart[y][0]:
            	z=10
            	
            	pipes[1][x] = size_chart[y][1]/304.8
#                print("entered")
                break
            y+=1
    y=0
            
	
#Assign your output to the OUT variable.
OUT = pipes[1]
# ----------------------------------------
watch_4 = Watch(chart_comparison)
setParameterByName = Element.SetParameterByName(element=filterByBoolMask.in, parameterName=parameter_to_change, value=chart_comparison)

# group: SELECT ALL PIPING SYSTEMS
categories_2 = Categories("PipingSystem")
all_elements_of_category_2 = ElementsOfCategory(categories_2)

# group: AVAILABLE PARAMETERS
parameters = Element.Parameters(all_elements_of_category_2)

# group: FILTER THE SYSTEM TO BE MODIFIED
name = Element.Name(all_elements_of_category_2)
code_block = CodeBlock { "LTHW"; }
code_block_2 = CodeBlock { 1; }
contains = String.Contains(str=name, searchFor=code_block, ignoreCase=code_block_2)
filterByBoolMask_2 = List.FilterByBoolMask(list=all_elements_of_category_2, mask=contains)

# group: SELECT THE PIPE NETWORK
elements_in_connected_network = Custom[Elements in connected network](Element=filterByBoolMask_2.in)  # Returns all elements that are physically connected to the input element

# group: DIVIDE PIPE FROM FITTINGS
getCategory = Element.GetCategory(elements_in_connected_network)
name_2 = Element.Name(getCategory)
code_block_3 = CodeBlock { "Pipes"; }
code_block_4 = CodeBlock { 1; }
contains_2 = String.Contains(str=name_2, searchFor=code_block_3, ignoreCase=code_block_4)
filterByBoolMask_3 = List.FilterByBoolMask(list=elements_in_connected_network, mask=contains_2)

# group: FITTINGS
parameter_to_change_2 = StringInput("Nominal Radius")
getParameterValueByName_4 = Element.GetParameterValueByName(element=filterByBoolMask_3.out, parameterName=parameter_to_change_2)

# group: PIPES
parameter_to_change_3 = StringInput("Diameter")
parameter_to_monitor_2 = StringInput("Fixture Units")
getParameterValueByName_5 = Element.GetParameterValueByName(element=filterByBoolMask_3.in, parameterName=parameter_to_monitor_2)
getParameterValueByName_6 = Element.GetParameterValueByName(element=filterByBoolMask_3.in, parameterName=parameter_to_change_3)

# group: CHART
string_3 = StringInput("5psi/100")
sizing_chart_2 = Python(IN[0]=string_3)  # same code as sizing_chart
string_4 = StringInput("3psi/100")
watch_5 = Watch(sizing_chart_2)

create_2 = List.Create(getParameterValueByName_5, getParameterValueByName_6)
chart_comparison_2 = Python(IN[0]=sizing_chart_2, IN[1]=create_2)  # same code as chart_comparison

# group: SET PIPE DIAMETER
setParameterByName_2 = Element.SetParameterByName(element=filterByBoolMask_3.in, parameterName=parameter_to_change_3, value=chart_comparison_2)

code_block_5 = CodeBlock(value=chart_comparison_2) { value/2; }

# group: SET FITTING RADIUS
setParameterByName_3 = Element.SetParameterByName(element=filterByBoolMask_3.out, parameterName=parameter_to_change_2, value=code_block_5)

# group: TEST
code_block_6 = CodeBlock { 108; }
convert_between_units = DynamoConvert(code_block_6, conversionMetric=Length, conversionFrom=Millimeters, conversionTo=Feet)
