# Dynamo graph energyModel01.dyn (Dynamo 1.3.1.1736)

select_model_elements = DSModelElementsSelection()
code_block = CodeBlock(a=select_model_elements) { a[1..3]; }
select_model_elements_2 = DSModelElementsSelection()
python_script = Python(IN[0]=select_model_elements_2)
# ---------- python_script.python (21 lines) ----------
import clr

clr.AddReference("RevitServices")
import RevitServices
from RevitServices.Persistence import DocumentManager
from RevitServices.Transactions import TransactionManager
doc = DocumentManager.Instance.CurrentDBDocument

clr.AddReference("RevitAPI")
import Autodesk
from Autodesk.Revit.DB import *

clr.AddReference("RevitNodes")
import Revit
clr.ImportExtensions(Revit.Elements)
clr.ImportExtensions(Revit.GeometryConversion)

energySrf = UnwrapElement(IN[0])
	
	
OUT = energySrf.GetAnalyticalOpenings()
# ----------------------------------------
python_script_2 = Python(IN[0]=python_script)
# ---------- python_script_2.python (27 lines) ----------
import clr

clr.AddReference("RevitServices")
import RevitServices
from RevitServices.Persistence import DocumentManager
from RevitServices.Transactions import TransactionManager
doc = DocumentManager.Instance.CurrentDBDocument

clr.AddReference("RevitAPI")
import Autodesk
from Autodesk.Revit.DB import *

clr.AddReference("RevitNodes")
import Revit
clr.ImportExtensions(Revit.Elements)
clr.ImportExtensions(Revit.GeometryConversion)

opt = Options()
opt.ComputeReferences = True
opt.IncludeNonVisibleObjects = True
opt.View = doc.ActiveView

energySrf = UnwrapElement(IN[0])


	
OUT = energySrf[0].GetPolyloop()
# ----------------------------------------
python_script_3 = Python(IN[0]=python_script_2)
# ---------- python_script_3.python (23 lines) ----------
import clr

clr.AddReference("RevitServices")
import RevitServices
from RevitServices.Persistence import DocumentManager
from RevitServices.Transactions import TransactionManager
doc = DocumentManager.Instance.CurrentDBDocument

clr.AddReference("RevitAPI")
import Autodesk
from Autodesk.Revit.DB import *

clr.AddReference("RevitNodes")
import Revit
clr.ImportExtensions(Revit.Elements)
clr.ImportExtensions(Revit.GeometryConversion)


poly = UnwrapElement(IN[0])


	
OUT = poly.ComputeArea()*1000, poly.GetPoints()
# ----------------------------------------
python_script_4 = Python(IN[0]=python_script)
# ---------- python_script_4.python (34 lines) ----------
import clr

clr.AddReference("RevitServices")
import RevitServices
from RevitServices.Persistence import DocumentManager
from RevitServices.Transactions import TransactionManager
doc = DocumentManager.Instance.CurrentDBDocument

clr.AddReference("RevitAPI")
import Autodesk
from Autodesk.Revit.DB import *

clr.AddReference("RevitNodes")
import Revit
clr.ImportExtensions(Revit.Elements)
clr.ImportExtensions(Revit.GeometryConversion)

opt = Options()
opt.ComputeReferences = True
opt.IncludeNonVisibleObjects = True
opt.View = doc.ActiveView

energySrf = UnwrapElement(IN[0])

geo = []
whole = []
converted = []
for obj in energySrf[0].get_Geometry(opt):
	if isinstance(obj, Solid):
		geo.append(obj)
	converted.append(obj.Convert());
	whole.append(obj.ConvertToMany())
	
OUT = geo, geo[0].SurfaceArea/10.76391041671, whole, converted
# ----------------------------------------
code_block_2 = CodeBlock(a=python_script_4) { a[0]; }
python_script_5 = Python(IN[0]=code_block_2)
# ---------- python_script_5.python (32 lines) ----------
import clr

clr.AddReference("RevitServices")
import RevitServices
from RevitServices.Persistence import DocumentManager
from RevitServices.Transactions import TransactionManager
doc = DocumentManager.Instance.CurrentDBDocument

clr.AddReference("RevitAPI")
import Autodesk
from Autodesk.Revit.DB import *

clr.AddReference("RevitNodes")
import Revit
clr.ImportExtensions(Revit.Elements)
clr.ImportExtensions(Revit.GeometryConversion)

opt = Options()
opt.ComputeReferences = True
opt.IncludeNonVisibleObjects = True
opt.View = doc.ActiveView

geo = UnwrapElement(IN[0])

edges = geo[0].Edges
crv = []
for e in edges:
	crv.append(e.AsCurve().ToProtoType())
	
	
	
OUT = geo[0].SurfaceArea/10.76391041671, geo[0].Faces, edges, geo[0].Edges.GetEnumerator(), crv
# ----------------------------------------
code_block_3 = CodeBlock(a=python_script_5) { a[1]; }
python_script_6 = Python(IN[0]=code_block_3)
# ---------- python_script_6.python (26 lines) ----------
import clr
clr.AddReference('ProtoGeometry')
from Autodesk.DesignScript.Geometry import *

clr.AddReference("RevitServices")
import RevitServices
from RevitServices.Persistence import DocumentManager
from RevitServices.Transactions import TransactionManager
doc = DocumentManager.Instance.CurrentDBDocument

clr.AddReference("RevitAPI")
import Autodesk
from Autodesk.Revit.DB import *

clr.AddReference("RevitNodes")
import Revit
clr.ImportExtensions(Revit.Elements)
clr.ImportExtensions(Revit.GeometryConversion)

face = IN[0][0].ToProtoType()

dir = face[0].NormalAtParameter(0.5,0.5)


	
OUT = face, dir, IN[0][0].FaceNormal 
# ----------------------------------------
code_block_4 = CodeBlock(faces=python_script_6) { faces[0].NormalAtParameter(0.5,0.5); }
geometry = Element.Geometry(select_model_elements)
code_block_5 = CodeBlock { 0; }
getItemAtIndex = List.GetItemAtIndex(list=geometry, index=code_block_5, lacing=Longest)
code_block_6 = CodeBlock { 0.5; }
code_block_7 = CodeBlock(t1=getItemAtIndex, t2=code_block_6) { vector1 = t1.NormalAtParameter(t2, t2); }
code_block_8 = CodeBlock(a=python_script_4) { a[2][0][0]; }
pointAtParameter = Surface.PointAtParameter(surface=getItemAtIndex, u=code_block_6, v=code_block_6)
code_block_9 = CodeBlock { 0.5; }
normalAtParameter = Surface.NormalAtParameter(surface=getItemAtIndex, u=code_block_9, v=code_block_9)
reverse = Vector.Reverse(normalAtParameter, lacing=Longest)
code_block_10 = CodeBlock { 1000; }
byStartPointDirectionLength = Line.ByStartPointDirectionLength(startPoint=pointAtParameter, direction=reverse, length=code_block_10)
byCurve = ModelCurve.ByCurve(byStartPointDirectionLength)
categories = Categories("Windows")
all_elements_of_category = ElementsOfCategory(categories)

# group: calculate area
python_script_7 = Python(IN[0]=python_script)
# ---------- python_script_7.python (44 lines) ----------
import clr

clr.AddReference("RevitServices")
import RevitServices
from RevitServices.Persistence import DocumentManager
from RevitServices.Transactions import TransactionManager
doc = DocumentManager.Instance.CurrentDBDocument

clr.AddReference("RevitAPI")
import Autodesk
from Autodesk.Revit.DB import *

clr.AddReference("RevitNodes")
import Revit
clr.ImportExtensions(Revit.Elements)
clr.ImportExtensions(Revit.GeometryConversion)

import math


opt = Options()
opt.ComputeReferences = True
opt.IncludeNonVisibleObjects = True
opt.View = doc.ActiveView

energySrf = UnwrapElement(IN[0])

geo = []
whole = []
converted = []

for srf in energySrf:
	for obj in srf.get_Geometry(opt):
		if isinstance(obj, Solid):
			geo.append(obj)
		converted.append(obj.Convert());
		whole.append(obj.ConvertToMany())

area = []

for g in geo:
	area.append(round((g.SurfaceArea/10.76391041671),2))

OUT = geo, area
# ----------------------------------------
