# Dynamo graph Circuit Renaming.dyn (Dynamo 0.8.2.2392)

categories = Categories("ElectricalFixtures")
all_elements_of_category = ElementsOfCategory(categories)
watch = Watch(all_elements_of_category)
code_block = CodeBlock { "Panel"; }
getParameterValueByName = Element.GetParameterValueByName(element=all_elements_of_category, parameterName=code_block)

# group: CIRCUITS
code_block_2 = CodeBlock { "PP01"; }
code_block_3 = CodeBlock { 1; }
element_types = ElementTypes("ElectricalSystem")
all_elements_of_type = ElementsOfType(element_types)
code_block_4 = CodeBlock { "Panel"; }
getParameterValueByName_2 = Element.GetParameterValueByName(element=all_elements_of_type, parameterName=code_block_4)
contains = String.Contains(str=getParameterValueByName_2, searchFor=code_block_2, ignoreCase=code_block_3)
filterByBoolMask = List.FilterByBoolMask(list=all_elements_of_type, mask=contains)
code_block_5 = CodeBlock { "Circuit Number"; }
getParameterValueByName_3 = Element.GetParameterValueByName(element=filterByBoolMask.in, parameterName=code_block_5)

contains_2 = String.Contains(str=getParameterValueByName, searchFor=code_block_2, ignoreCase=code_block_3)
filterByBoolMask_2 = List.FilterByBoolMask(list=all_elements_of_category, mask=contains_2)
code_block_6 = CodeBlock { "Circuit Number"; }
getParameterValueByName_4 = Element.GetParameterValueByName(element=filterByBoolMask_2.in, parameterName=code_block_6)
contains_3 = String.Contains(str=getParameterValueByName_4, searchFor=getParameterValueByName_3, lacing=CrossProduct)
transpose = List.Transpose(contains_3)
code_block_7 = CodeBlock { true; }
containsItem = List.ContainsItem(item=code_block_7, lacing=Longest)
map = List.Map(f_x=containsItem)
map_2 = List.Map(list=transpose, f_x=map)
filterByBoolMask_3 = List.FilterByBoolMask()
create = List.Create(filterByBoolMask_2.in)
code_block_8 = CodeBlock(a=getParameterValueByName_3) { List.Count(a); }
cycle = List.Cycle(list=create, amount=code_block_8)
eq = getParameterValueByName_3 == getParameterValueByName_4  # lacing=CrossProduct
boolean = BoolSelector(true)
boolean_2 = BoolSelector(false)
if_ = If(test=eq, true=boolean, false=boolean_2)
combine = List.Combine(filterByBoolMask_3.in, cycle, if_)
code_block_9 = CodeBlock(a=combine) { a[0]; }
code_block_10 = CodeBlock(a=code_block_9) { Flatten(a); }
collect_all_familyinstance_using = Custom[Collect all FamilyInstance using Element Types]()  # should get model family instances
get_linked_rvt_documents = Custom[Get Linked RVT Documents]()
firstItem = List.FirstItem(get_linked_rvt_documents.Link_Doc)
categories_2 = Categories("Rooms")
python_script = Python(IN[0]=firstItem, IN[1]=categories_2)
# ---------- python_script.python (42 lines) ----------
#Copyright(c) 2015, Konrad Sobon
# @arch_laboratory, http://archi-lab.net

# This node is based on Julien Benoit's Element.GetElementFromLinkedFile 
# node. Some slight improvements were made removing unnecessary imports/references.
# Big thank you to Julien for sharing his work. 

import clr
clr.AddReference('ProtoGeometry')
from Autodesk.DesignScript.Geometry import *

# Import RevitAPI
clr.AddReference("RevitAPI")
import Autodesk
from Autodesk.Revit.DB import *

import System

import sys
pyt_path = r'C:\Program Files (x86)\IronPython 2.7\Lib'
sys.path.append(pyt_path)

#The inputs to this node will be stored as a list in the IN variable.
dataEnteringNode = IN

_linkDoc = IN[0]
_category = IN[1]

try:
	errorReport = None
	filter = ElementCategoryFilter(System.Enum.ToObject(BuiltInCategory, _category.Id))
	result = FilteredElementCollector(_linkDoc).WherePasses(filter).WhereElementIsNotElementType().ToElements()
except:
	# if error accurs anywhere in the process catch it
	import traceback
	errorReport = traceback.format_exc()

#Assign your output to the OUT variable
if errorReport == None:
	OUT = result
else:
	OUT = errorReport
# ----------------------------------------
code_block_11 = CodeBlock { "Name"; }
code_block_12 = CodeBlock { "Number"; }
code_block_13 = CodeBlock { "Type"; }
code_block_14 = CodeBlock { "Mark"; }
collect_elements_in_rooms_and = Custom[Collect Elements in Rooms and Show Detailed List](Elements=collect_all_familyinstance_using, Rooms=python_script, RoomParameterOne=code_block_11, RoomParameterTwo=code_block_12, ElementParameterOne=code_block_13, ElementParameterTwo=code_block_14)  # Allows you to generate various lists of elements in rooms. Can get two parameters for Rooms, and two for Elements. Based on Family.InRoom work by Konrad, which was built on others.
watch_2 = Watch(collect_elements_in_rooms_and.RoomParameterTwo)
watch_3 = Watch(collect_elements_in_rooms_and.ElementParameterTwo)
