# Dynamo graph Circuit Renaming01.dyn (Dynamo 0.8.2.2392)

categories = Categories("ElectricalFixtures")
all_elements_of_category = ElementsOfCategory(categories)
watch = Watch(all_elements_of_category)
code_block = CodeBlock { "Panel"; }
getParameterValueByName = Element.GetParameterValueByName(element=all_elements_of_category, parameterName=code_block)

# group: CIRCUITS
code_block_2 = CodeBlock { "PP01"; }
code_block_3 = CodeBlock { 1; }
element_types = ElementTypes("ElectricalSystem")
all_elements_of_type = ElementsOfType(element_types)
code_block_4 = CodeBlock { "Panel"; }
getParameterValueByName_2 = Element.GetParameterValueByName(element=all_elements_of_type, parameterName=code_block_4)
contains = String.Contains(str=getParameterValueByName_2, searchFor=code_block_2, ignoreCase=code_block_3)
filterByBoolMask = List.FilterByBoolMask(list=all_elements_of_type, mask=contains)
code_block_5 = CodeBlock { "Circuit Number"; }
getParameterValueByName_3 = Element.GetParameterValueByName(element=filterByBoolMask.in, parameterName=code_block_5)

contains_2 = String.Contains(str=getParameterValueByName, searchFor=code_block_2, ignoreCase=code_block_3)
filterByBoolMask_2 = List.FilterByBoolMask(list=all_elements_of_category, mask=contains_2)
code_block_6 = CodeBlock { "Circuit Number"; }
getParameterValueByName_4 = Element.GetParameterValueByName(element=filterByBoolMask_2.in, parameterName=code_block_6)
contains_3 = String.Contains(str=getParameterValueByName_4, searchFor=getParameterValueByName_3, lacing=CrossProduct)
transpose = List.Transpose(contains_3)
code_block_7 = CodeBlock { true; }
containsItem = List.ContainsItem(item=code_block_7, lacing=Longest)
map = List.Map(f_x=containsItem)
map_2 = List.Map(list=transpose, f_x=map)
element_types_2 = ElementTypes("FamilyInstance")
all_elements_of_type_2 = ElementsOfType(element_types_2)
flatten = Flatten(all_elements_of_type_2)
id = Element.Id(flatten)
filterByBoolMask_3 = List.FilterByBoolMask()
create = List.Create(filterByBoolMask_2.in)
code_block_8 = CodeBlock(a=getParameterValueByName_3) { List.Count(a); }
cycle = List.Cycle(list=create, amount=code_block_8)
eq = getParameterValueByName_3 == getParameterValueByName_4  # lacing=CrossProduct
boolean = BoolSelector(true)
boolean_2 = BoolSelector(false)
if_ = If(test=eq, true=boolean, false=boolean_2)
combine = List.Combine(filterByBoolMask_3.in, cycle, if_)
code_block_9 = CodeBlock(a=combine) { a[0]; }
id_2 = Element.Id(code_block_9)
eq_2 = id == id_2  # lacing=CrossProduct
countTrue = CountTrue(eq_2, lacing=Longest)
code_block_10 = CodeBlock { 1; }
eq_3 = countTrue == code_block_10  # lacing=CrossProduct
flatten_2 = Flatten(eq_3)
filterByBoolMask_4 = List.FilterByBoolMask(list=flatten, mask=flatten_2)
flatten_3 = Flatten(filterByBoolMask_4.in)
get_linked_rvt_documents = Custom[Get Linked RVT Documents]()
firstItem = List.FirstItem(get_linked_rvt_documents.Link_Doc)
categories_2 = Categories("Rooms")
python_script = Python(IN[0]=firstItem, IN[1]=categories_2)
# ---------- python_script.python (42 lines) ----------
#Copyright(c) 2015, Konrad Sobon
# @arch_laboratory, http://archi-lab.net

# This node is based on Julien Benoit's Element.GetElementFromLinkedFile 
# node. Some slight improvements were made removing unnecessary imports/references.
# Big thank you to Julien for sharing his work. 

import clr
clr.AddReference('ProtoGeometry')
from Autodesk.DesignScript.Geometry import *

# Import RevitAPI
clr.AddReference("RevitAPI")
import Autodesk
from Autodesk.Revit.DB import *

import System

import sys
pyt_path = r'C:\Program Files (x86)\IronPython 2.7\Lib'
sys.path.append(pyt_path)

#The inputs to this node will be stored as a list in the IN variable.
dataEnteringNode = IN

_linkDoc = IN[0]
_category = IN[1]

try:
	errorReport = None
	filter = ElementCategoryFilter(System.Enum.ToObject(BuiltInCategory, _category.Id))
	result = FilteredElementCollector(_linkDoc).WherePasses(filter).WhereElementIsNotElementType().ToElements()
except:
	# if error accurs anywhere in the process catch it
	import traceback
	errorReport = traceback.format_exc()

#Assign your output to the OUT variable
if errorReport == None:
	OUT = result
else:
	OUT = errorReport
# ----------------------------------------
inRooms = Python(IN[0]=flatten_3, IN[1]=python_script)  # "Families.InRooms"
# ---------- inRooms.python (53 lines) ----------
#Copyright(c) 2015, Konrad Sobon
# @arch_laboratory, http://archi-lab.net

# This code is based on Family.InRoom node originally created
# by Peter Kompolschek and published on Dynamo blog. Big thanks 
# to Peter for sharing his work so graciously.

import clr
clr.AddReference('ProtoGeometry')
from Autodesk.DesignScript.Geometry import *

# Import DocumentManager and TransactionManager
clr.AddReference("RevitServices")
import RevitServices
from RevitServices.Persistence import DocumentManager
from RevitServices.Transactions import TransactionManager

# Import RevitAPI
clr.AddReference("RevitAPI")
import Autodesk
from Autodesk.Revit.DB import *

doc = DocumentManager.Instance.CurrentDBDocument
uiapp = DocumentManager.Instance.CurrentUIApplication
app = uiapp.Application

from System.Collections.Generic import *

#The inputs to this node will be stored as a list in the IN variable.
def FamiliesInRoom(_room, _families):
	outList = []
	for family in _families:
		try:
			pt = family.Location.Point
		except:
			pt = family.Location.Curve.Origin
		if _room.IsPointInRoom(pt):
			outList.append(family)
	return outList

families = []
for i in IN[0]:
	families.append(UnwrapElement(i))

rooms = []
for i in IN[1]:
	rooms.append(UnwrapElement(i))

outData = [[] for i in range(len(rooms))]
for index, room in enumerate(rooms):
	outData[index].extend(FamiliesInRoom(room, families))

OUT = outData
# ----------------------------------------
output = CodeBlock(SimpleList=inRooms) { SimpleList; }
cycle_2 = List.Cycle()
count = List.Count(inRooms)
code_block_11 = CodeBlock(a=count) { 0..a; }
count_2 = List.Count()
map_3 = List.Map(list=inRooms, f_x=count_2)
laceShortest = List.LaceShortest(cycle_2, code_block_11, map_3)
getItemAtIndex = List.GetItemAtIndex(list=python_script, index=laceShortest)
flatten_4 = Flatten(getItemAtIndex)
flatten_5 = Flatten(inRooms)
create_2 = List.Create(flatten_4, flatten_5)
output_2 = CodeBlock(CycledList=create_2) { CycledList; }

# group: Matches number of rooms
watch_2 = Watch(inRooms)

watch_3 = Watch(flatten_5)
element_ids = Custom[Element Ids](Element_s=flatten_4)
code_block_12 = CodeBlock { "Name"; }
getParameterValueByName_5 = Element.GetParameterValueByName(element=flatten_4, parameterName=code_block_12)
code_block_13 = CodeBlock { "Number"; }
getParameterValueByName_6 = Element.GetParameterValueByName(element=flatten_4, parameterName=code_block_13)
element_ids_2 = Custom[Element Ids](Element_s=flatten_5)
code_block_14 = CodeBlock { "Type"; }
getParameterValueByName_7 = Element.GetParameterValueByName(element=flatten_5, parameterName=code_block_14)
code_block_15 = CodeBlock { "Mark"; }
getParameterValueByName_8 = Element.GetParameterValueByName(element=flatten_5, parameterName=code_block_15)
create_3 = List.Create(element_ids.Id_String_s, getParameterValueByName_5, getParameterValueByName_6, element_ids_2.Id_String_s, getParameterValueByName_7, getParameterValueByName_8)
transpose_2 = List.Transpose(create_3)
select_model_elements = DSModelElementsSelection()
watch_4 = Watch(select_model_elements)
