# Dynamo graph Circuit Renaming02.dyn (Dynamo 0.8.2.2392)

categories = Categories("ElectricalFixtures")
all_elements_of_category = ElementsOfCategory(categories)
watch = Watch(all_elements_of_category)

# group: CIRCUITS
element_types = ElementTypes("ElectricalSystem")
all_elements_of_type = ElementsOfType(element_types)
code_block = CodeBlock { "Panel"; }
getParameterValueByName = Element.GetParameterValueByName(element=all_elements_of_type, parameterName=code_block)
code_block_2 = CodeBlock { "PP11"; }
code_block_3 = CodeBlock { 1; }
contains = String.Contains(str=getParameterValueByName, searchFor=code_block_2, ignoreCase=code_block_3)
filterByBoolMask = List.FilterByBoolMask(list=all_elements_of_type, mask=contains)
code_block_4 = CodeBlock { "Circuit Number"; }
getParameterValueByName_2 = Element.GetParameterValueByName(element=filterByBoolMask.in, parameterName=code_block_4)

watch_2 = Watch(getParameterValueByName_2)
watch_3 = Watch(code_block_2)
filterByBoolMask_2 = List.FilterByBoolMask()
code_block_5 = CodeBlock { "Panel"; }
getParameterValueByName_3 = Element.GetParameterValueByName(element=all_elements_of_category, parameterName=code_block_5)
contains_2 = String.Contains(str=getParameterValueByName_3, searchFor=code_block_2, ignoreCase=code_block_3)
filterByBoolMask_3 = List.FilterByBoolMask(list=all_elements_of_category, mask=contains_2)
create = List.Create(filterByBoolMask_3.in)
code_block_6 = CodeBlock(a=getParameterValueByName_2) { List.Count(a); }
cycle = List.Cycle(list=create, amount=code_block_6)
code_block_7 = CodeBlock { "Circuit Number"; }
getParameterValueByName_4 = Element.GetParameterValueByName(element=filterByBoolMask_3.in, parameterName=code_block_7)
eq = getParameterValueByName_2 == getParameterValueByName_4  # lacing=CrossProduct
boolean = BoolSelector(true)
boolean_2 = BoolSelector(false)
if_ = If(test=eq, true=boolean, false=boolean_2)
combine = List.Combine(filterByBoolMask_2.in, cycle, if_)
code_block_8 = CodeBlock(a=combine) { Flatten(a); }
get_linked_rvt_documents = Custom[Get Linked RVT Documents]()
firstItem = List.FirstItem(get_linked_rvt_documents.Link_Doc)
categories_2 = Categories("Rooms")
python_script = Python(IN[0]=firstItem, IN[1]=categories_2)
# ---------- python_script.python (42 lines) ----------
#Copyright(c) 2015, Konrad Sobon
# @arch_laboratory, http://archi-lab.net

# This node is based on Julien Benoit's Element.GetElementFromLinkedFile 
# node. Some slight improvements were made removing unnecessary imports/references.
# Big thank you to Julien for sharing his work. 

import clr
clr.AddReference('ProtoGeometry')
from Autodesk.DesignScript.Geometry import *

# Import RevitAPI
clr.AddReference("RevitAPI")
import Autodesk
from Autodesk.Revit.DB import *

import System

import sys
pyt_path = r'C:\Program Files (x86)\IronPython 2.7\Lib'
sys.path.append(pyt_path)

#The inputs to this node will be stored as a list in the IN variable.
dataEnteringNode = IN

_linkDoc = IN[0]
_category = IN[1]

try:
	errorReport = None
	filter = ElementCategoryFilter(System.Enum.ToObject(BuiltInCategory, _category.Id))
	result = FilteredElementCollector(_linkDoc).WherePasses(filter).WhereElementIsNotElementType().ToElements()
except:
	# if error accurs anywhere in the process catch it
	import traceback
	errorReport = traceback.format_exc()

#Assign your output to the OUT variable
if errorReport == None:
	OUT = result
else:
	OUT = errorReport
# ----------------------------------------
code_block_9 = CodeBlock { "Name"; }
code_block_10 = CodeBlock { "Number"; }
code_block_11 = CodeBlock { "Type"; }
code_block_12 = CodeBlock { "Mark"; }
collect_elements_in_rooms_and = Custom[Collect Elements in Rooms and Show Detailed List](Elements=code_block_8, Rooms=python_script, RoomParameterOne=code_block_9, RoomParameterTwo=code_block_10, ElementParameterOne=code_block_11, ElementParameterTwo=code_block_12)  # Allows you to generate various lists of elements in rooms. Can get two parameters for Rooms, and two for Elements. Based on Family.InRoom work by Konrad, which was built on others.
watch_4 = Watch(collect_elements_in_rooms_and.RoomParameterTwo)
count = List.Count(combine, lacing=Longest)
py_list_chop_by_length = Python(IN[0]=watch_4, IN[1]=count)
# ---------- py_list_chop_by_length.python (15 lines) ----------
import clr

inputlist = IN[0]
listlengths = IN[1]
rowcounter = 0
elementlist = list()
for item in listlengths:
	itemcounter = 0
	itemlist = list()
	while itemcounter < item:
		itemlist.append(inputlist[rowcounter])
		rowcounter += 1
		itemcounter += 1
	elementlist.append(itemlist)
OUT = elementlist
# ----------------------------------------
watch_5 = Watch(collect_elements_in_rooms_and.ElementParameterTwo)
py_list_chop_by_length_2 = Python(IN[0]=watch_5, IN[1]=count)  # same code as py_list_chop_by_length
