# Dynamo graph Circuit Renaming03 v08.dyn (Dynamo 0.8.2.2392)

categories = Categories("ElectricalFixtures")
all_elements_of_category = ElementsOfCategory(categories)
watch = Watch(all_elements_of_category)
file_path = Filename("C:\Users\giovanni.brogioli\Documents\Dynamo\Scripts\MEP\Test.xlsx")
code_block = CodeBlock { "MEP"; }
code_block_2 = CodeBlock { 0; }
code_block_3 = CodeBlock { "id"; }
code_block_4 = CodeBlock { "Name"; }
code_block_5 = CodeBlock { "Number"; }
code_block_6 = CodeBlock { "Comments"; }

# group: CIRCUITS
code_block_7 = CodeBlock { "Circuit Number"; }
code_block_8 = CodeBlock { "PP01"; }
code_block_9 = CodeBlock { 1; }
element_types = ElementTypes("ElectricalSystem")
all_elements_of_type = ElementsOfType(element_types)
code_block_10 = CodeBlock { "Panel"; }
getParameterValueByName = Element.GetParameterValueByName(element=all_elements_of_type, parameterName=code_block_10)
contains = String.Contains(str=getParameterValueByName, searchFor=code_block_8, ignoreCase=code_block_9)
filterByBoolMask = List.FilterByBoolMask(list=all_elements_of_type, mask=contains)
getParameterValueByName_2 = Element.GetParameterValueByName(element=filterByBoolMask.in, parameterName=code_block_7)

create = List.Create(code_block_3, code_block_4, code_block_5, code_block_6, code_block_6, code_block_7)
filterByBoolMask_2 = List.FilterByBoolMask()
code_block_11 = CodeBlock { "Panel"; }
getParameterValueByName_3 = Element.GetParameterValueByName(element=all_elements_of_category, parameterName=code_block_11)
contains_2 = String.Contains(str=getParameterValueByName_3, searchFor=code_block_8, ignoreCase=code_block_9)
filterByBoolMask_3 = List.FilterByBoolMask(list=all_elements_of_category, mask=contains_2)
create_2 = List.Create(filterByBoolMask_3.in)
code_block_12 = CodeBlock(a=getParameterValueByName_2) { List.Count(a); }
cycle = List.Cycle(list=create_2, amount=code_block_12)
code_block_13 = CodeBlock { "Circuit Number"; }
getParameterValueByName_4 = Element.GetParameterValueByName(element=filterByBoolMask_3.in, parameterName=code_block_13)
eq = getParameterValueByName_2 == getParameterValueByName_4  # lacing=CrossProduct
boolean = BoolSelector(true)
boolean_2 = BoolSelector(false)
if_ = If(test=eq, true=boolean, false=boolean_2)
combine = List.Combine(filterByBoolMask_2.in, cycle, if_)
code_block_14 = CodeBlock(a=combine) { Flatten(a); }
get_linked_rvt_documents = Custom[Get Linked RVT Documents]()
firstItem = List.FirstItem(get_linked_rvt_documents.Link_Doc)
categories_2 = Categories("Rooms")
python_script = Python(IN[0]=firstItem, IN[1]=categories_2)
# ---------- python_script.python (42 lines) ----------
#Copyright(c) 2015, Konrad Sobon
# @arch_laboratory, http://archi-lab.net

# This node is based on Julien Benoit's Element.GetElementFromLinkedFile 
# node. Some slight improvements were made removing unnecessary imports/references.
# Big thank you to Julien for sharing his work. 

import clr
clr.AddReference('ProtoGeometry')
from Autodesk.DesignScript.Geometry import *

# Import RevitAPI
clr.AddReference("RevitAPI")
import Autodesk
from Autodesk.Revit.DB import *

import System

import sys
pyt_path = r'C:\Program Files (x86)\IronPython 2.7\Lib'
sys.path.append(pyt_path)

#The inputs to this node will be stored as a list in the IN variable.
dataEnteringNode = IN

_linkDoc = IN[0]
_category = IN[1]

try:
	errorReport = None
	filter = ElementCategoryFilter(System.Enum.ToObject(BuiltInCategory, _category.Id))
	result = FilteredElementCollector(_linkDoc).WherePasses(filter).WhereElementIsNotElementType().ToElements()
except:
	# if error accurs anywhere in the process catch it
	import traceback
	errorReport = traceback.format_exc()

#Assign your output to the OUT variable
if errorReport == None:
	OUT = result
else:
	OUT = errorReport
# ----------------------------------------
code_block_15 = CodeBlock(a=get_linked_rvt_documents.Link_Doc) { a[3]; }
categories_3 = Categories("Rooms")
python_script_2 = Python(IN[0]=code_block_15, IN[1]=categories_3)  # same code as python_script
create_3 = List.Create(python_script, python_script_2)
code_block_16 = CodeBlock(a=create_3) { Flatten(a); }
code_block_17 = CodeBlock { "Circuit Number"; }
collect_elements_in_rooms_and = Custom[Collect Elements in Rooms and Show Detailed List](Elements=code_block_14, Rooms=code_block_16, RoomParameterOne=code_block_4, RoomParameterTwo=code_block_5, ElementParameterOne=code_block_6, ElementParameterTwo=code_block_17)  # Allows you to generate various lists of elements in rooms. Can get two parameters for Rooms, and two for Elements. Based on Family.InRoom work by Konrad, which was built on others.
watch_2 = Watch(collect_elements_in_rooms_and.DetailedCombinedListForExcel)
addItemToFront = List.AddItemToFront(item=create, list=watch_2)
code_block_18 = CodeBlock { 1; }
writeToFile = Excel.WriteToFile(filePath=file_path, sheetName=code_block, startRow=code_block_2, startCol=code_block_2, data=addItemToFront, overWrite=code_block_18)
watch_3 = Watch(collect_elements_in_rooms_and.SimpleList)
select_model_element = DSModelElementSelection()  # 1 picked in the model
create_4 = List.Create(select_model_element)
inRooms = Python(IN[0]=create_4, IN[1]=python_script)  # "Families.InRooms"
# ---------- inRooms.python (50 lines) ----------
#Copyright(c) 2015, Konrad Sobon
# @arch_laboratory, http://archi-lab.net

# This code is based on Family.InRoom node originally created
# by Peter Kompolschek and published on Dynamo blog. Big thanks 
# to Peter for sharing his work so graciously.

import clr
clr.AddReference('ProtoGeometry')
from Autodesk.DesignScript.Geometry import *

# Import DocumentManager and TransactionManager
clr.AddReference("RevitServices")
import RevitServices
from RevitServices.Persistence import DocumentManager
from RevitServices.Transactions import TransactionManager

# Import RevitAPI
clr.AddReference("RevitAPI")
import Autodesk
from Autodesk.Revit.DB import *

doc = DocumentManager.Instance.CurrentDBDocument
uiapp = DocumentManager.Instance.CurrentUIApplication
app = uiapp.Application

from System.Collections.Generic import *

#The inputs to this node will be stored as a list in the IN variable.
def FamiliesInRoom(_room, _families):
	outList = []
	for family in _families:
		pt = family.Location.Point
		if _room.IsPointInRoom(pt):
			outList.append(family)
	return outList

families = []
for i in IN[0]:
	families.append(UnwrapElement(i))

rooms = []
for i in IN[1]:
	rooms.append(UnwrapElement(i))

outData = [[] for i in range(len(rooms))]
for index, room in enumerate(rooms):
	outData[index].extend(FamiliesInRoom(room, families))

OUT = outData
# ----------------------------------------
collect_elements_in_rooms_and_2 = Custom[Collect Elements in Rooms and Show Detailed List](Rooms=python_script, RoomParameterOne=code_block_4, RoomParameterTwo=code_block_5, ElementParameterOne=code_block_6, ElementParameterTwo=code_block_17)
watch_4 = Watch(collect_elements_in_rooms_and_2.DetailedCombinedListForExcel)
watch_5 = Watch(collect_elements_in_rooms_and_2.RoomElements)
create_5 = List.Create(code_block_16)
boundingBox = Geometry.BoundingBox(create_5)
isNull = Object.IsNull(boundingBox)
filterByBoolMask_4 = List.FilterByBoolMask(list=boundingBox, mask=isNull)
code_block_19 = CodeBlock(a=filterByBoolMask_4.out) { Flatten(a); }
select_model_element_2 = DSModelElementSelection()  # 1 picked in the model
location = FamilyInstance.Location(select_model_element_2)
code_block_20 = CodeBlock(a=location) { a[0]; }
contains_3 = BoundingBox.Contains(code_block_19, code_block_20)
countTrue = CountTrue(contains_3, lacing=Longest)
code_block_21 = CodeBlock { 1; }
eq_2 = _ == code_block_21  # lacing=CrossProduct
code_block_22 = CodeBlock(a=eq_2) { Flatten(a); }
py_contains = Python(IN[0]=code_block_20, IN[1]=code_block_19)
# ---------- py_contains.python (35 lines) ----------
import clr
clr.AddReference('ProtoGeometry')
from Autodesk.DesignScript.Geometry import *

# Import DocumentManager and TransactionManager
clr.AddReference("RevitServices")
import RevitServices
from RevitServices.Persistence import DocumentManager
from RevitServices.Transactions import TransactionManager

# Import RevitAPI
clr.AddReference("RevitAPI")
import Autodesk
from Autodesk.Revit.DB import *

doc = DocumentManager.Instance.CurrentDBDocument
uiapp = DocumentManager.Instance.CurrentUIApplication
app = uiapp.Application

from System.Collections.Generic import *


families = []
for i in IN[0]:
	families.append(UnwrapElement(i))

rooms = []
for i in IN[1]:
	rooms.append(UnwrapElement(i))

outData = [] 



OUT = outData
# ----------------------------------------
name = Element.Name(python_script)
code_block_23 = CodeBlock { "-151"; }
contains_4 = String.Contains(str=name, searchFor=code_block_23)
filterByBoolMask_5 = List.FilterByBoolMask(list=name, mask=contains_4)
name_2 = Element.Name(code_block_16)
code_block_24 = CodeBlock { "-151"; }
contains_5 = String.Contains(str=name_2, searchFor=code_block_24)
filterByBoolMask_6 = List.FilterByBoolMask(list=code_block_16, mask=contains_5)
boundingBox_2 = Geometry.BoundingBox(filterByBoolMask_6.in)
code_block_25 = CodeBlock(a=location) { a.Z+608510; }
code_block_26 = CodeBlock(a=location, b=location, c=code_block_25) { Point.ByCoordinates(a.X,b.Y,c); }
contains_6 = BoundingBox.Contains(boundingBox_2, code_block_26)
geometry = Element.Geometry(filterByBoolMask_6.in)
code_block_27 = CodeBlock(a=code_block_14) { a[0]; }
location_2 = Custom[Element.Location](element=code_block_27)  # Returns the location of an element as an XYZ (or if it's line-based the start and end point of the line), along with some booleans to help filtering the results. Use this for some element types (e.g. walls or lines) that do not work with the built-in Get Family Instance Location node.
maxPoint = BoundingBox.MaxPoint(boundingBox_2)
select_model_element_3 = DSModelElementSelection()
byCoordinates = Point.ByCoordinates()
space = Custom[Element.Space]()  # This will retrieve the space in which an element is contained. (if available)
