# Dynamo graph Circuit Renaming03.dyn (Dynamo 1.2.0.2514)

categories = Categories("ElectricalFixtures")
all_elements_of_category = ElementsOfCategory(categories)
watch = Watch(all_elements_of_category)
get_linked_rvt_documents = Custom[Get Linked RVT Documents]()
firstItem = List.FirstItem(get_linked_rvt_documents.Link_Doc)
categories_2 = Categories("Rooms")
python_script = Python(IN[0]=firstItem, IN[1]=categories_2)
# ---------- python_script.python (42 lines) ----------
#Copyright(c) 2015, Konrad Sobon
# @arch_laboratory, http://archi-lab.net

# This node is based on Julien Benoit's Element.GetElementFromLinkedFile 
# node. Some slight improvements were made removing unnecessary imports/references.
# Big thank you to Julien for sharing his work. 

import clr
clr.AddReference('ProtoGeometry')
from Autodesk.DesignScript.Geometry import *

# Import RevitAPI
clr.AddReference("RevitAPI")
import Autodesk
from Autodesk.Revit.DB import *

import System

import sys
pyt_path = r'C:\Program Files (x86)\IronPython 2.7\Lib'
sys.path.append(pyt_path)

#The inputs to this node will be stored as a list in the IN variable.
dataEnteringNode = IN

_linkDoc = IN[0]
_category = IN[1]

try:
	errorReport = None
	filter = ElementCategoryFilter(System.Enum.ToObject(BuiltInCategory, _category.Id))
	result = FilteredElementCollector(_linkDoc).WherePasses(filter).WhereElementIsNotElementType().ToElements()
except:
	# if error accurs anywhere in the process catch it
	import traceback
	errorReport = traceback.format_exc()

#Assign your output to the OUT variable
if errorReport == None:
	OUT = result
else:
	OUT = errorReport
# ----------------------------------------
filterByBoolMask = List.FilterByBoolMask()  # unwired: list, mask
code_block = CodeBlock { "Panel"; }
getParameterValueByName = Element.GetParameterValueByName(element=all_elements_of_category, parameterName=code_block)

# group: CIRCUITS
code_block_2 = CodeBlock { "PP-1A"; }
code_block_3 = CodeBlock { 1; }
element_types = ElementTypes("ElectricalSystem")
all_elements_of_type = ElementsOfType(element_types)
code_block_4 = CodeBlock { "Panel"; }
getParameterValueByName_2 = Element.GetParameterValueByName(element=all_elements_of_type, parameterName=code_block_4)
contains = String.Contains(str=getParameterValueByName_2, searchFor=code_block_2, ignoreCase=code_block_3)
filterByBoolMask_2 = List.FilterByBoolMask(list=all_elements_of_type, mask=contains)
code_block_5 = CodeBlock { "Circuit Number"; }
getParameterValueByName_3 = Element.GetParameterValueByName(element=filterByBoolMask_2.in, parameterName=code_block_5)

contains_2 = String.Contains(str=getParameterValueByName, searchFor=code_block_2, ignoreCase=code_block_3)
filterByBoolMask_3 = List.FilterByBoolMask(list=all_elements_of_category, mask=contains_2)
create = List.Create(filterByBoolMask_3.in)
code_block_6 = CodeBlock(a=getParameterValueByName_3) { List.Count(a); }
cycle = List.Cycle(list=create, amount=code_block_6)
code_block_7 = CodeBlock { "Circuit Number"; }
getParameterValueByName_4 = Element.GetParameterValueByName(element=filterByBoolMask_3.in, parameterName=code_block_7)
eq = getParameterValueByName_3 == getParameterValueByName_4  # lacing=CrossProduct
boolean = BoolSelector(true)
boolean_2 = BoolSelector(false)
if_ = If(test=eq, true=boolean, false=boolean_2)
combine = List.Combine(filterByBoolMask.in, cycle, if_)
code_block_8 = CodeBlock(a=combine) { Flatten(a); }
all_elements_of_category_2 = ElementsOfCategory(categories_2)
code_block_9 = CodeBlock { "Name"; }
code_block_10 = CodeBlock { "Number"; }
code_block_11 = CodeBlock { "Circuit Number"; }
code_block_12 = CodeBlock { "Mark"; }
collect_elements_in_rooms_and = Custom[Collect Elements in Rooms and Show Detailed List](Elements=code_block_8, Rooms=all_elements_of_category_2, RoomParameterOne=code_block_9, RoomParameterTwo=code_block_10, ElementParameterOne=code_block_11, ElementParameterTwo=code_block_12)  # Allows you to generate various lists of elements in rooms. Can get two parameters for Rooms, and two for Elements. Based on Family.InRoom work by Konrad, which was built on others.
watch_2 = Watch(collect_elements_in_rooms_and.DetailedCombinedListForExcel)
watch_3 = Watch(collect_elements_in_rooms_and.ElementParameterOne)
python_script_2 = Python(IN[0]=code_block_8, IN[1]=all_elements_of_category_2)
# ---------- python_script_2.python (50 lines) ----------
#Copyright(c) 2015, Konrad Sobon
# @arch_laboratory, http://archi-lab.net

# This code is based on Family.InRoom node originally created
# by Peter Kompolschek and published on Dynamo blog. Big thanks 
# to Peter for sharing his work so graciously.

import clr
clr.AddReference('ProtoGeometry')
from Autodesk.DesignScript.Geometry import *

# Import DocumentManager and TransactionManager
clr.AddReference("RevitServices")
import RevitServices
from RevitServices.Persistence import DocumentManager
from RevitServices.Transactions import TransactionManager

# Import RevitAPI
clr.AddReference("RevitAPI")
import Autodesk
from Autodesk.Revit.DB import *

doc = DocumentManager.Instance.CurrentDBDocument
uiapp = DocumentManager.Instance.CurrentUIApplication
app = uiapp.Application

from System.Collections.Generic import *

#The inputs to this node will be stored as a list in the IN variable.
def FamiliesInRoom(_room, _families):
	outList = []
	for family in _families:
		pt = family.Location.Point
		if _room.IsPointInRoom(pt):
			outList.append(family)
	return outList

families = []
for i in IN[0]:
	families.append(UnwrapElement(i))

rooms = []
for i in IN[1]:
	rooms.append(UnwrapElement(i))

outData = [[] for i in range(len(rooms))]
for index, room in enumerate(rooms):
	outData[index].extend(FamiliesInRoom(room, families))

OUT = outData
# ----------------------------------------
count = List.Count(python_script_2, lacing=Longest)
py_chop_list = Python(IN[0]=watch_3, IN[1]=count)
# ---------- py_chop_list.python (15 lines) ----------
import clr

inputlist = IN[0]
listlengths = IN[1]
rowcounter = 0
elementlist = list()
for item in listlengths:
	itemcounter = 0
	itemlist = list()
	while itemcounter < item:
		itemlist.append(inputlist[rowcounter])
		rowcounter += 1
		itemcounter += 1
	elementlist.append(itemlist)
OUT = elementlist
# ----------------------------------------
watch_4 = Watch(collect_elements_in_rooms_and.RoomParameterTwo)
py_chop_list_2 = Python(IN[0]=watch_4, IN[1]=count)  # same code as py_chop_list
sum = Math.Sum(count)
watch_5 = Watch(collect_elements_in_rooms_and.ElementIds)
py_chop_list_3 = Python(IN[0]=collect_elements_in_rooms_and.ElementParameterTwo, IN[1]=count)  # same code as py_chop_list
watch_6 = Watch(getParameterValueByName_3)
location = FamilyInstance.Location(python_script_2)
center = Polygon.Center()  # unwired: arg0
boundaries = Custom[Room.Boundaries](Room=all_elements_of_category_2)  # This node returns all Room bounding curves and elements that generated them (walls, separation lines etc).
simplify = Custom[CurveLoop.Simplify](curveLoop=boundaries.Curve)  # Attempts to simplify an open or a closed curve loop by connecting straight separate line segments into a single line.
