# Dynamo graph Circuit Renaming04 v08.dyn (Dynamo 0.8.2.2392)

categories = Categories("ElectricalFixtures")
all_elements_of_category = ElementsOfCategory(categories)
watch = Watch(all_elements_of_category)
file_path = Filename("C:\Users\giovanni.brogioli\Documents\Dynamo\Scripts\MEP\Test.xlsx")
code_block = CodeBlock { "MEP"; }
code_block_2 = CodeBlock { 0; }
code_block_3 = CodeBlock { "id"; }
code_block_4 = CodeBlock { "Name"; }
code_block_5 = CodeBlock { "Number"; }
code_block_6 = CodeBlock { "Comments"; }

# group: CIRCUITS
code_block_7 = CodeBlock { "Circuit Number"; }
code_block_8 = CodeBlock { "PP01"; }
code_block_9 = CodeBlock { 1; }
element_types = ElementTypes("ElectricalSystem")
all_elements_of_type = ElementsOfType(element_types)
code_block_10 = CodeBlock { "Panel"; }
getParameterValueByName = Element.GetParameterValueByName(element=all_elements_of_type, parameterName=code_block_10)
contains = String.Contains(str=getParameterValueByName, searchFor=code_block_8, ignoreCase=code_block_9)
filterByBoolMask = List.FilterByBoolMask(list=all_elements_of_type, mask=contains)
getParameterValueByName_2 = Element.GetParameterValueByName(element=filterByBoolMask.in, parameterName=code_block_7)

create = List.Create(code_block_3, code_block_4, code_block_5, code_block_6, code_block_6, code_block_7)
filterByBoolMask_2 = List.FilterByBoolMask()
code_block_11 = CodeBlock { "Panel"; }
getParameterValueByName_3 = Element.GetParameterValueByName(element=all_elements_of_category, parameterName=code_block_11)
contains_2 = String.Contains(str=getParameterValueByName_3, searchFor=code_block_8, ignoreCase=code_block_9)
filterByBoolMask_3 = List.FilterByBoolMask(list=all_elements_of_category, mask=contains_2)
create_2 = List.Create(filterByBoolMask_3.in)
code_block_12 = CodeBlock(a=getParameterValueByName_2) { List.Count(a); }
cycle = List.Cycle(list=create_2, amount=code_block_12)
code_block_13 = CodeBlock { "Circuit Number"; }
getParameterValueByName_4 = Element.GetParameterValueByName(element=filterByBoolMask_3.in, parameterName=code_block_13)
eq = getParameterValueByName_2 == getParameterValueByName_4  # lacing=CrossProduct
boolean = BoolSelector(true)
boolean_2 = BoolSelector(false)
if_ = If(test=eq, true=boolean, false=boolean_2)
combine = List.Combine(filterByBoolMask_2.in, cycle, if_)
code_block_14 = CodeBlock(a=combine) { Flatten(a); }
get_linked_rvt_documents = Custom[Get Linked RVT Documents]()
firstItem = List.FirstItem(get_linked_rvt_documents.Link_Doc)
categories_2 = Categories("Rooms")
python_script = Python(IN[0]=firstItem, IN[1]=categories_2)
# ---------- python_script.python (42 lines) ----------
#Copyright(c) 2015, Konrad Sobon
# @arch_laboratory, http://archi-lab.net

# This node is based on Julien Benoit's Element.GetElementFromLinkedFile 
# node. Some slight improvements were made removing unnecessary imports/references.
# Big thank you to Julien for sharing his work. 

import clr
clr.AddReference('ProtoGeometry')
from Autodesk.DesignScript.Geometry import *

# Import RevitAPI
clr.AddReference("RevitAPI")
import Autodesk
from Autodesk.Revit.DB import *

import System

import sys
pyt_path = r'C:\Program Files (x86)\IronPython 2.7\Lib'
sys.path.append(pyt_path)

#The inputs to this node will be stored as a list in the IN variable.
dataEnteringNode = IN

_linkDoc = IN[0]
_category = IN[1]

try:
	errorReport = None
	filter = ElementCategoryFilter(System.Enum.ToObject(BuiltInCategory, _category.Id))
	result = FilteredElementCollector(_linkDoc).WherePasses(filter).WhereElementIsNotElementType().ToElements()
except:
	# if error accurs anywhere in the process catch it
	import traceback
	errorReport = traceback.format_exc()

#Assign your output to the OUT variable
if errorReport == None:
	OUT = result
else:
	OUT = errorReport
# ----------------------------------------
code_block_15 = CodeBlock(a=get_linked_rvt_documents.Link_Doc) { a[3]; }
categories_3 = Categories("Rooms")
python_script_2 = Python(IN[0]=code_block_15, IN[1]=categories_3)  # same code as python_script
create_3 = List.Create(python_script, python_script_2)
code_block_16 = CodeBlock(a=create_3) { Flatten(a); }
code_block_17 = CodeBlock { "Circuit Number"; }
collect_elements_in_rooms_and = Custom[Collect Elements in Rooms and Show Detailed List](Elements=code_block_14, Rooms=code_block_16, RoomParameterOne=code_block_4, RoomParameterTwo=code_block_5, ElementParameterOne=code_block_6, ElementParameterTwo=code_block_17)  # Allows you to generate various lists of elements in rooms. Can get two parameters for Rooms, and two for Elements. Based on Family.InRoom work by Konrad, which was built on others.
watch_2 = Watch(collect_elements_in_rooms_and.DetailedCombinedListForExcel)
addItemToFront = List.AddItemToFront(item=create, list=watch_2)
code_block_18 = CodeBlock { 1; }
writeToFile = Excel.WriteToFile(filePath=file_path, sheetName=code_block, startRow=code_block_2, startCol=code_block_2, data=addItemToFront, overWrite=code_block_18)
watch_3 = Watch(collect_elements_in_rooms_and.SimpleList)
