# Dynamo graph Circuit Renaming05 v08.dyn (Dynamo 0.8.2.2392)

categories = Categories("ElectricalFixtures")
all_elements_of_category = ElementsOfCategory(categories)
watch = Watch(all_elements_of_category)
file_path = Filename("C:\Users\giovanni.brogioli\Documents\Dynamo\Scripts\MEP\Test.xlsx")
code_block = CodeBlock { "MEP"; }
code_block_2 = CodeBlock { 0; }
addItemToEnd = List.AddItemToEnd()
filterByBoolMask = List.FilterByBoolMask()
code_block_3 = CodeBlock { "Panel"; }
getParameterValueByName = Element.GetParameterValueByName(element=all_elements_of_category, parameterName=code_block_3)

# group: CIRCUITS
code_block_4 = CodeBlock { "PP01"; }
code_block_5 = CodeBlock { 1; }
element_types = ElementTypes("ElectricalSystem")
all_elements_of_type = ElementsOfType(element_types)
code_block_6 = CodeBlock { "Panel"; }
getParameterValueByName_2 = Element.GetParameterValueByName(element=all_elements_of_type, parameterName=code_block_6)
contains = String.Contains(str=getParameterValueByName_2, searchFor=code_block_4, ignoreCase=code_block_5)
filterByBoolMask_2 = List.FilterByBoolMask(list=all_elements_of_type, mask=contains)
code_block_7 = CodeBlock { "Circuit Number"; }
getParameterValueByName_3 = Element.GetParameterValueByName(element=filterByBoolMask_2.in, parameterName=code_block_7)

contains_2 = String.Contains(str=getParameterValueByName, searchFor=code_block_4, ignoreCase=code_block_5)
filterByBoolMask_3 = List.FilterByBoolMask(list=all_elements_of_category, mask=contains_2)
create = List.Create(filterByBoolMask_3.in)
code_block_8 = CodeBlock(a=getParameterValueByName_3) { List.Count(a); }
cycle = List.Cycle(list=create, amount=code_block_8)
code_block_9 = CodeBlock { "Circuit Number"; }
getParameterValueByName_4 = Element.GetParameterValueByName(element=filterByBoolMask_3.in, parameterName=code_block_9)
eq = getParameterValueByName_3 == getParameterValueByName_4  # lacing=CrossProduct
boolean = BoolSelector(true)
boolean_2 = BoolSelector(false)
if_ = If(test=eq, true=boolean, false=boolean_2)
combine = List.Combine(filterByBoolMask.in, cycle, if_)
space = Custom[Element.Space](element=combine, lacing=Longest)  # This will retrieve the space in which an element is contained. (if available)
code_block_10 = CodeBlock { "Number"; }
getParameterValueByName_5 = Element.GetParameterValueByName(element=space, parameterName=code_block_10)
addItemToEnd_2 = List.AddItemToEnd()
code_block_11 = CodeBlock { "Name"; }
getParameterValueByName_6 = Element.GetParameterValueByName(element=space, parameterName=code_block_11)
addItemToFront = List.AddItemToFront()
watch_2 = Watch(getParameterValueByName_3)
combine_2 = List.Combine(addItemToFront, watch_2, combine)
combine_3 = List.Combine(addItemToEnd_2, getParameterValueByName_6, combine_2)
code_block_12 = CodeBlock { 1; }
flatten = List.Flatten(list=combine_3, amt=code_block_12)
combine_4 = List.Combine(addItemToEnd, getParameterValueByName_5, flatten)
code_block_13 = CodeBlock { 1; }
flatten_2 = List.Flatten(list=combine_4, amt=code_block_13)
code_block_14 = CodeBlock { 1; }
writeToFile = Excel.WriteToFile(filePath=file_path, sheetName=code_block, startRow=code_block_2, startCol=code_block_2, data=flatten_2, overWrite=code_block_14)
addItemToFront_2 = List.AddItemToFront()
code_block_15 = CodeBlock(a=combine) { Flatten(a); }
code_block_16 = CodeBlock(a=code_block_15) { a[0]; }
location = Custom[Element.Location](element=code_block_16)  # Returns the location of an element as an XYZ (or if it's line-based the start and end point of the line), along with some booleans to help filtering the results. Use this for some element types (e.g. walls or lines) that do not work with the built-in Get Family Instance Location node.
byCoordinates = Point.ByCoordinates()
