# Dynamo graph Circuit Renaming06 v08.dyn (Dynamo 0.8.2.2392)

categories = Categories("ElectricalFixtures")
all_elements_of_category = ElementsOfCategory(categories)
watch = Watch(all_elements_of_category)
file_path = Filename("C:\Users\giovanni.brogioli\Documents\Dynamo\Scripts\MEP\Test.xlsx")
code_block = CodeBlock { "MEP"; }
code_block_2 = CodeBlock { 0; }
code_block_3 = CodeBlock { 1; }
writeToFile = Excel.WriteToFile(filePath=file_path, sheetName=code_block, startRow=code_block_2, startCol=code_block_2, overWrite=code_block_3)

# group: CIRCUITS
element_types = ElementTypes("ElectricalSystem")
all_elements_of_type = ElementsOfType(element_types)
code_block_4 = CodeBlock { "Panel"; }
getParameterValueByName = Element.GetParameterValueByName(element=all_elements_of_type, parameterName=code_block_4)
code_block_5 = CodeBlock { "PP13"; }
code_block_6 = CodeBlock { 1; }
contains = String.Contains(str=getParameterValueByName, searchFor=code_block_5, ignoreCase=code_block_6)
filterByBoolMask = List.FilterByBoolMask(list=all_elements_of_type, mask=contains)
code_block_7 = CodeBlock { "Circuit Number"; }
getParameterValueByName_2 = Element.GetParameterValueByName(element=filterByBoolMask.in, parameterName=code_block_7)

watch_2 = Watch(getParameterValueByName_2)
filterByBoolMask_2 = List.FilterByBoolMask()
code_block_8 = CodeBlock { "Panel"; }
getParameterValueByName_3 = Element.GetParameterValueByName(element=all_elements_of_category, parameterName=code_block_8)
contains_2 = String.Contains(str=getParameterValueByName_3, searchFor=code_block_5, ignoreCase=code_block_6)
filterByBoolMask_3 = List.FilterByBoolMask(list=all_elements_of_category, mask=contains_2)
create = List.Create(filterByBoolMask_3.in)
code_block_9 = CodeBlock(a=getParameterValueByName_2) { List.Count(a); }
cycle = List.Cycle(list=create, amount=code_block_9)
code_block_10 = CodeBlock { "Circuit Number"; }
getParameterValueByName_4 = Element.GetParameterValueByName(element=filterByBoolMask_3.in, parameterName=code_block_10)
eq = getParameterValueByName_2 == getParameterValueByName_4  # lacing=CrossProduct
boolean = BoolSelector(true)
boolean_2 = BoolSelector(false)
if_ = If(test=eq, true=boolean, false=boolean_2)
combine = List.Combine(filterByBoolMask_2.in, cycle, if_)
space = Custom[Element.Space](element=combine, lacing=Longest)  # This will retrieve the space in which an element is contained. (if available)
count = List.Count(combine, lacing=Longest)
code_block_11 = CodeBlock { "Load Name"; }
code_block_12 = CodeBlock { "Identity_Reference"; }
getParameterValueByName_5 = Element.GetParameterValueByName(element=combine, parameterName=code_block_12)
uniqueItems = List.UniqueItems(getParameterValueByName_5, lacing=Longest)
list_items_to_string = Custom[List items to String](List=uniqueItems)

# group: ROOM
code_block_13 = CodeBlock { "Name"; }
getParameterValueByName_6 = Element.GetParameterValueByName(element=space, parameterName=code_block_13)
code_block_14 = CodeBlock { "Error"; }
replaceNulls = Lists.Manage.ReplaceNulls(getParameterValueByName_6, code_block_14)
uniqueItems_2 = List.UniqueItems(replaceNulls, lacing=Longest)
list_items_to_string_2 = Custom[List items to String](List=uniqueItems_2)
code_block_15 = CodeBlock { "Number"; }
getParameterValueByName_7 = Element.GetParameterValueByName(element=space, parameterName=code_block_15)
code_block_16 = CodeBlock { "Error"; }
replaceNulls_2 = Lists.Manage.ReplaceNulls(getParameterValueByName_7, code_block_16)
uniqueItems_3 = List.UniqueItems(replaceNulls_2, lacing=Longest)
list_items_to_string_3 = Custom[List items to String](List=uniqueItems_3)
create_2 = List.Create(watch_2, list_items_to_string_2, list_items_to_string_3, count)
python_script = Python(IN[0]=list_items_to_string_2, IN[1]=list_items_to_string_3, IN[2]=list_items_to_string)
# ---------- python_script.python (13 lines) ----------
import clr
clr.AddReference('ProtoGeometry')
from Autodesk.DesignScript.Geometry import *
#The inputs to this node will be stored as a list in the IN variables.
a = IN[0]
b = IN[1]
c = IN[2]

OUT = []
for i in range(0,len(a)):
	subOut = []
	subOut.append(a[i]+str(" ")+b[i]+str(" ")+c[i])
	OUT.append(subOut)
# ----------------------------------------

code_block_17 = CodeBlock(a=python_script) { Flatten(a); }
setParameterByName = Element.SetParameterByName(element=filterByBoolMask.in, parameterName=code_block_11, value=code_block_17)
getParameterValueByName_8 = Element.GetParameterValueByName(element=combine, parameterName=code_block_12)
