# Dynamo graph Circuit Renaming07 v09 Rooms.dyn (Dynamo 0.8.2.2392)

categories = Categories("ElectricalFixtures")
all_elements_of_category = ElementsOfCategory(categories)
watch = Watch(all_elements_of_category)
code_block = CodeBlock { "Load Name"; }
filterByBoolMask = List.FilterByBoolMask()
code_block_2 = CodeBlock { "Panel"; }
getParameterValueByName = Element.GetParameterValueByName(element=all_elements_of_category, parameterName=code_block_2)

# group: CIRCUITS
code_block_3 = CodeBlock { "EPP49"; }
code_block_4 = CodeBlock { 1; }
element_types = ElementTypes("ElectricalSystem")
all_elements_of_type = ElementsOfType(element_types)
code_block_5 = CodeBlock { "Panel"; }
getParameterValueByName_2 = Element.GetParameterValueByName(element=all_elements_of_type, parameterName=code_block_5)
contains = String.Contains(str=getParameterValueByName_2, searchFor=code_block_3, ignoreCase=code_block_4)
filterByBoolMask_2 = List.FilterByBoolMask(list=all_elements_of_type, mask=contains)
code_block_6 = CodeBlock { "Circuit Number"; }
getParameterValueByName_3 = Element.GetParameterValueByName(element=filterByBoolMask_2.in, parameterName=code_block_6)

contains_2 = String.Contains(str=getParameterValueByName, searchFor=code_block_3, ignoreCase=code_block_4)
filterByBoolMask_3 = List.FilterByBoolMask(list=all_elements_of_category, mask=contains_2)
create = List.Create(filterByBoolMask_3.in)
code_block_7 = CodeBlock(a=getParameterValueByName_3) { List.Count(a); }
cycle = List.Cycle(list=create, amount=code_block_7)
code_block_8 = CodeBlock { "Circuit Number"; }
getParameterValueByName_4 = Element.GetParameterValueByName(element=filterByBoolMask_3.in, parameterName=code_block_8)
eq = getParameterValueByName_3 == getParameterValueByName_4  # lacing=CrossProduct
boolean = BoolSelector(true)
boolean_2 = BoolSelector(false)
if_ = If(test=eq, true=boolean, false=boolean_2)

# group: ELECTRICAL FIXTURES PER PANEL
combine = List.Combine(filterByBoolMask.in, cycle, if_)

space = Custom[Element.Space](element=combine, lacing=Longest)  # This will retrieve the space in which an element is contained. (if available)

# group: ROOM
code_block_9 = CodeBlock { "Error"; }
code_block_10 = CodeBlock { "Name"; }
getParameterValueByName_5 = Element.GetParameterValueByName(element=space, parameterName=code_block_10)
code_block_11 = CodeBlock { "Number"; }
getParameterValueByName_6 = Element.GetParameterValueByName(element=space, parameterName=code_block_11)

isNull = Object.IsNull(getParameterValueByName_5)
python_script = Python(IN[0]=getParameterValueByName_5, IN[1]=isNull)
# ---------- python_script.python (23 lines) ----------
# Copyright (c) 2014, Nathan Miller
# The Proving Ground, http://TheProvingGround.org

# Default imports
import clr
clr.AddReference('ProtoGeometry')
from Autodesk.DesignScript.Geometry import *

#The input to this node will be stored in the IN[0] variable.
list = IN[0]
bol = IN[1]

OUT = []

for i in range(0,len(list)):
	nu = []
	for j in range(0,len(list[i])):
		#if list[i][j].IsNull():
		if bol[i][j]==True:
			nu.append("error")
		else:
			nu.append(list[i][j])
	OUT.append(nu)
# ----------------------------------------

# group (continued): ROOM
uniqueItems = List.UniqueItems(python_script, lacing=Longest)

isNull_2 = Object.IsNull(getParameterValueByName_6)
python_script_2 = Python(IN[0]=getParameterValueByName_6, IN[1]=isNull_2)  # same code as python_script

# group (continued): ROOM
uniqueItems_2 = List.UniqueItems(python_script_2, lacing=Longest)

code_block_12 = CodeBlock(a=uniqueItems, b=uniqueItems_2) { a+" "+b; }

# group (continued): ROOM
list_items_to_string = Custom[List items to String](List=code_block_12)

code_block_13 = CodeBlock { ","; }
code_block_14 = CodeBlock { ", "; }
replace = String.Replace(str=list_items_to_string, searchFor=code_block_13, replaceWith=code_block_14)
code_block_15 = CodeBlock { "Identity_Reference"; }
getParameterValueByName_7 = Element.GetParameterValueByName(element=combine, parameterName=code_block_15)
uniqueItems_3 = List.UniqueItems(getParameterValueByName_7, lacing=Longest)
list_items_to_string_2 = Custom[List items to String](List=uniqueItems_3)
code_block_16 = CodeBlock { ","; }
code_block_17 = CodeBlock { ", "; }
replace_2 = String.Replace(str=list_items_to_string_2, searchFor=code_block_16, replaceWith=code_block_17)
code_block_18 = CodeBlock(a=replace, b=replace_2) { a+" - "+b; }
length = String.Length(code_block_18)
code_block_19 = CodeBlock(a=length) { a<50; }
list_items_to_string_3 = Custom[List items to String](List=uniqueItems_2)
code_block_20 = CodeBlock(a=list_items_to_string_3, b=replace_2) { a+" - "+b; }
if_2 = If(test=code_block_19, true=code_block_18, false=code_block_20)
setParameterByName = Element.SetParameterByName(parameterName=code_block, value=if_2)
file_path = Filename("C:\Users\giovanni.brogioli\Documents\Dynamo\Scripts\MEP\Test.xlsx")
code_block_21 = CodeBlock { "MEP"; }
code_block_22 = CodeBlock { 0; }
code_block_23 = CodeBlock { 1; }
writeToFile = Excel.WriteToFile(filePath=file_path, sheetName=code_block_21, startRow=code_block_22, startCol=code_block_22, overWrite=code_block_23)
file_path_2 = Filename("C:\Users\giovanni.brogioli\Documents\Dynamo\Scripts\MEP\tESTO")
code_block_24 = CodeBlock { "MEP"; }
code_block_25 = CodeBlock { 1; }
code_block_26 = CodeBlock(a=combine) { Flatten(a); }
get_linked_rvt_documents = Custom[Get Linked RVT Documents]()
firstItem = List.FirstItem(get_linked_rvt_documents.Link_Doc)
categories_2 = Categories("Rooms")
python_script_3 = Python(IN[0]=firstItem, IN[1]=categories_2)
# ---------- python_script_3.python (42 lines) ----------
#Copyright(c) 2015, Konrad Sobon
# @arch_laboratory, http://archi-lab.net

# This node is based on Julien Benoit's Element.GetElementFromLinkedFile 
# node. Some slight improvements were made removing unnecessary imports/references.
# Big thank you to Julien for sharing his work. 

import clr
clr.AddReference('ProtoGeometry')
from Autodesk.DesignScript.Geometry import *

# Import RevitAPI
clr.AddReference("RevitAPI")
import Autodesk
from Autodesk.Revit.DB import *

import System

import sys
pyt_path = r'C:\Program Files (x86)\IronPython 2.7\Lib'
sys.path.append(pyt_path)

#The inputs to this node will be stored as a list in the IN variable.
dataEnteringNode = IN

_linkDoc = IN[0]
_category = IN[1]

try:
	errorReport = None
	filter = ElementCategoryFilter(System.Enum.ToObject(BuiltInCategory, _category.Id))
	result = FilteredElementCollector(_linkDoc).WherePasses(filter).WhereElementIsNotElementType().ToElements()
except:
	# if error accurs anywhere in the process catch it
	import traceback
	errorReport = traceback.format_exc()

#Assign your output to the OUT variable
if errorReport == None:
	OUT = result
else:
	OUT = errorReport
# ----------------------------------------
code_block_27 = CodeBlock { "Name"; }
code_block_28 = CodeBlock { "Number"; }
code_block_29 = CodeBlock { "Comments"; }
code_block_30 = CodeBlock { "Circuit Number"; }
collect_elements_in_rooms_and = Custom[Collect Elements in Rooms and Show Detailed List](Elements=code_block_26, Rooms=python_script_3, RoomParameterOne=code_block_27, RoomParameterTwo=code_block_28, ElementParameterOne=code_block_29, ElementParameterTwo=code_block_30)  # Allows you to generate various lists of elements in rooms. Can get two parameters for Rooms, and two for Elements. Based on Family.InRoom work by Konrad, which was built on others.
code_block_31 = CodeBlock { 1; }
writeToFile_2 = Excel.WriteToFile(filePath=file_path_2, sheetName=code_block_24, startRow=code_block_25, startCol=code_block_25, data=collect_elements_in_rooms_and.DetailedCombinedListForExcel, overWrite=code_block_31)
code_block_32 = CodeBlock { 0; }
count = List.Count(combine, lacing=Longest)
python_script_4 = Python(IN[0]=count)
# ---------- python_script_4.python (17 lines) ----------
import clr
clr.AddReference('ProtoGeometry')
from Autodesk.DesignScript.Geometry import *


#The inputs to this node will be stored as a list in the IN variables.
cnt = IN[0]


total  = 0
sums   = []

for v in cnt:
  total = total + v
  sums.append(total)
    
OUT = sums
# ----------------------------------------
addItemToFront = List.AddItemToFront(item=code_block_32, list=python_script_4)
dropLast = Custom[List.DropLast](list=addItemToFront)  # Removes the last value of the list.
python_script_5 = Python(IN[1]=dropLast, IN[2]=python_script_4)
# ---------- python_script_5.python (11 lines) ----------
import clr
clr.AddReference('ProtoGeometry')
from Autodesk.DesignScript.Geometry import *
#The inputs to this node will be stored as a list in the IN variables.
lst = IN[0]
start = IN[1]
end = IN[2]
OUT = []

for s,e in zip(start,end):
	OUT.append(lst[s:e])
# ----------------------------------------
watch_2 = Watch(getParameterValueByName_3)
watch_3 = Watch(collect_elements_in_rooms_and.DetailedCombinedListForExcel)
code_block_33 = CodeBlock { 5; }
getItemAtIndex = List.GetItemAtIndex(list=watch_3, index=code_block_33, lacing=Longest)
