# Dynamo graph Circuit Renaming07 v09.dyn (Dynamo 0.8.2.2392)

categories = Categories("ElectricalFixtures")
all_elements_of_category = ElementsOfCategory(categories)
watch = Watch(all_elements_of_category)

# group: CIRCUITS
element_types = ElementTypes("ElectricalSystem")
all_elements_of_type = ElementsOfType(element_types)
code_block = CodeBlock { "Panel"; }
getParameterValueByName = Element.GetParameterValueByName(element=all_elements_of_type, parameterName=code_block)
code_block_2 = CodeBlock { "PP56"; }
code_block_3 = CodeBlock { 1; }
contains = String.Contains(str=getParameterValueByName, searchFor=code_block_2, ignoreCase=code_block_3)
filterByBoolMask = List.FilterByBoolMask(list=all_elements_of_type, mask=contains)
code_block_4 = CodeBlock { "Circuit Number"; }
getParameterValueByName_2 = Element.GetParameterValueByName(element=filterByBoolMask.in, parameterName=code_block_4)

code_block_5 = CodeBlock { "Load Name"; }
filterByBoolMask_2 = List.FilterByBoolMask()
code_block_6 = CodeBlock { "Panel"; }
getParameterValueByName_3 = Element.GetParameterValueByName(element=all_elements_of_category, parameterName=code_block_6)
contains_2 = String.Contains(str=getParameterValueByName_3, searchFor=code_block_2, ignoreCase=code_block_3)
filterByBoolMask_3 = List.FilterByBoolMask(list=all_elements_of_category, mask=contains_2)
create = List.Create(filterByBoolMask_3.in)
code_block_7 = CodeBlock(a=getParameterValueByName_2) { List.Count(a); }
cycle = List.Cycle(list=create, amount=code_block_7)
code_block_8 = CodeBlock { "Circuit Number"; }
getParameterValueByName_4 = Element.GetParameterValueByName(element=filterByBoolMask_3.in, parameterName=code_block_8)
eq = getParameterValueByName_2 == getParameterValueByName_4  # lacing=CrossProduct
boolean = BoolSelector(true)
boolean_2 = BoolSelector(false)
if_ = If(test=eq, true=boolean, false=boolean_2)

# group: ELECTRICAL FIXTURES PER PANEL
combine = List.Combine(filterByBoolMask_2.in, cycle, if_)

space = Custom[Element.Space](element=combine, lacing=Longest)  # This will retrieve the space in which an element is contained. (if available)

# group: ROOM
code_block_9 = CodeBlock { "Error"; }
code_block_10 = CodeBlock { "Name"; }
getParameterValueByName_5 = Element.GetParameterValueByName(element=space, parameterName=code_block_10)
code_block_11 = CodeBlock { "Number"; }
getParameterValueByName_6 = Element.GetParameterValueByName(element=space, parameterName=code_block_11)

isNull = Object.IsNull(getParameterValueByName_5)
python_script = Python(IN[0]=getParameterValueByName_5, IN[1]=isNull)
# ---------- python_script.python (23 lines) ----------
# Copyright (c) 2014, Nathan Miller
# The Proving Ground, http://TheProvingGround.org

# Default imports
import clr
clr.AddReference('ProtoGeometry')
from Autodesk.DesignScript.Geometry import *

#The input to this node will be stored in the IN[0] variable.
list = IN[0]
bol = IN[1]

OUT = []

for i in range(0,len(list)):
	nu = []
	for j in range(0,len(list[i])):
		#if list[i][j].IsNull():
		if bol[i][j]==True:
			nu.append("error")
		else:
			nu.append(list[i][j])
	OUT.append(nu)
# ----------------------------------------

# group (continued): ROOM
uniqueItems = List.UniqueItems(python_script, lacing=Longest)

isNull_2 = Object.IsNull(getParameterValueByName_6)
python_script_2 = Python(IN[0]=getParameterValueByName_6, IN[1]=isNull_2)  # same code as python_script

# group (continued): ROOM
uniqueItems_2 = List.UniqueItems(python_script_2, lacing=Longest)

code_block_12 = CodeBlock(a=uniqueItems, b=uniqueItems_2) { a+" "+b; }

# group (continued): ROOM
list_items_to_string = Custom[List items to String](List=code_block_12)

code_block_13 = CodeBlock { ","; }
code_block_14 = CodeBlock { ", "; }
replace = String.Replace(str=list_items_to_string, searchFor=code_block_13, replaceWith=code_block_14)
code_block_15 = CodeBlock { "Identity_Reference"; }
getParameterValueByName_7 = Element.GetParameterValueByName(element=combine, parameterName=code_block_15)
uniqueItems_3 = List.UniqueItems(getParameterValueByName_7, lacing=Longest)
list_items_to_string_2 = Custom[List items to String](List=uniqueItems_3)
code_block_16 = CodeBlock { ","; }
code_block_17 = CodeBlock { ", "; }
replace_2 = String.Replace(str=list_items_to_string_2, searchFor=code_block_16, replaceWith=code_block_17)
code_block_18 = CodeBlock(a=replace, b=replace_2) { a+" - "+b; }
length = String.Length(code_block_18)
code_block_19 = CodeBlock(a=length) { a<50; }
list_items_to_string_3 = Custom[List items to String](List=uniqueItems_2)
code_block_20 = CodeBlock(a=list_items_to_string_3, b=replace_2) { a+" - "+b; }
if_2 = If(test=code_block_19, true=code_block_18, false=code_block_20)
setParameterByName = Element.SetParameterByName(element=filterByBoolMask.in, parameterName=code_block_5, value=if_2)
file_path = Filename("C:\Users\giovanni.brogioli\Documents\Dynamo\Scripts\MEP\Test.xlsx")
code_block_21 = CodeBlock { "MEP"; }
code_block_22 = CodeBlock { 0; }
code_block_23 = CodeBlock { 1; }
writeToFile = Excel.WriteToFile(filePath=file_path, sheetName=code_block_21, startRow=code_block_22, startCol=code_block_22, overWrite=code_block_23)
