# Dynamo graph Curtain panels from envelope model2.dyn (Dynamo 0.8.2.2392)

get_documents = Custom[Get Documents]()  # Queries all linked Revit files and retrieves their Name, LinkInstance and Document properties.
watch = Watch(get_documents.Link_Name)
code_block = CodeBlock(A=get_documents.Link_Doc) { A[0]; }
categories = Categories("Rooms")
get_all_elements_from_linked = Custom[Get All Elements From Linked Model](Link_Document=code_block, Category=categories)  # This node is based on code posted by Julien Benoit. Big thanks to Julien for sharing his work. This node will retrieve all elements of a given category from a given linked model.

# group: Remove nulls and empty lists
# note: This is the list with nulls and empty elements
geometry = Element.Geometry(get_all_elements_from_linked)
string_from_object = FromObject(geometry)
code_block_2 = CodeBlock { "Solid"; }
firstIndexOf = List.FirstIndexOf(item=code_block_2)
map = List.Map(list=string_from_object, f_x=firstIndexOf)
code_block_3 = CodeBlock { 0; }
eq = map == code_block_3
# note: This is the resulting list without nulls and empty elements
filterByBoolMask_Solids = List.FilterByBoolMask(list=geometry, mask=eq)  # "List.FilterByBoolMask_Solids"
id = Element.Id(get_all_elements_from_linked)
filterByBoolMask_ID = List.FilterByBoolMask(list=id, mask=eq)  # "List.FilterByBoolMask_ID"
filterByBoolMask_Elements = List.FilterByBoolMask(list=get_all_elements_from_linked, mask=eq)  # "List.FilterByBoolMask_Elements"

bySolid = PolySurface.BySolid(filterByBoolMask_Solids.in)
code_block_4 = CodeBlock { -10; }
offset = Surface.Offset(bySolid, code_block_4)

# group: Get curtain panels
code_block_5 = CodeBlock { true; }
lunchbox_curtain_panel_collector = Custom[LunchBox Curtain Panel Collector](Toggle=code_block_5)  # Collects curtain panel instances and references them.
geometry_2 = Element.Geometry(lunchbox_curtain_panel_collector.Element)

doesIntersect = Geometry.DoesIntersect(geometry=offset, other=geometry_2, lacing=CrossProduct)
code_block_6 = CodeBlock { true; }
contains = Contains(arg1=code_block_6)
map_2 = List.Map(list=doesIntersect, f_x=contains)
filterByBoolMask = List.FilterByBoolMask(list=offset, mask=map_2)
intersect = Geometry.Intersect(geometry=filterByBoolMask.in, other=geometry_2, lacing=CrossProduct)
filterByBoolMask_2 = List.FilterByBoolMask(list=filterByBoolMask_ID.in, mask=map_2)
filterByBoolMask_3 = List.FilterByBoolMask(list=filterByBoolMask_Elements.in, mask=map_2)
countTrue = CountTrue(map_2)
