# Dynamo graph Is Text.dyn (Dynamo 0.8.2.2392)

select_model_elements = DSModelElementsSelection()  # 1790 picked in the model
code_block = CodeBlock { "Line Style"; }
getParameterValueByName = Element.GetParameterValueByName(element=select_model_elements, parameterName=code_block)
name = Parameter.Name(getParameterValueByName)
removeNulls = Lists.Manage.RemoveNulls(name)
code_block_2 = CodeBlock { 1277; }
split = Custom[List.Split](list=select_model_elements, amount=code_block_2)  # Splits a list at the desired length
code_block_3 = CodeBlock { "OAP291__"; }
contains = String.Contains(str=name, searchFor=code_block_3)
filterByBoolMask = List.FilterByBoolMask(list=split.list1, mask=contains)
watch = Watch(filterByBoolMask.out)
watch_2 = Watch(split.list1)
watch_3 = Watch(filterByBoolMask.in)
code_block_4 = CodeBlock { "5 Arup Continuous Line"; }
setParameterByName = Element.SetParameterByName(element=watch_3, parameterName=code_block, value=code_block_4)
boolean = BoolSelector(true)
getLineStyleByName = Custom[Tool.GetLineStyleByName](Ignore_Case_boolean=boolean, Contains_String=code_block_4)  # Collects LineStyle from string.contains
code_block_5 = CodeBlock { 0; }
getItemAtIndex = List.GetItemAtIndex(list=getLineStyleByName.LineStyle_Internal, index=code_block_5)
