# Dynamo graph Mechanical_Flows.dyn (Dynamo 0.8.2.2392)

# group: select the space and terminal units with an inverted window
select_model_elements = DSModelElementsSelection()

categories = Categories("MEPSpaces")
isOfCategory = Custom[Element.IsOfCategory](element=select_model_elements, category=categories)  # Checks whether an element is of a specified category
filterByBoolMask = List.FilterByBoolMask(list=select_model_elements, mask=isOfCategory)
geometry = Element.Geometry(filterByBoolMask.in)
categories_2 = Categories("DuctTerminal")
isOfCategory_2 = Custom[Element.IsOfCategory](element=select_model_elements, category=categories_2)
filterByBoolMask_2 = List.FilterByBoolMask(list=select_model_elements, mask=isOfCategory_2)
string = StringInput("System Classification")
getParameterValueByName = Element.GetParameterValueByName(element=filterByBoolMask_2.in, parameterName=string)
string_2 = StringInput("Supply Air")
containsItem = List.ContainsItem(list=getParameterValueByName, item=string_2, lacing=Longest)
flatten = Flatten(containsItem)
filterByBoolMask_3 = List.FilterByBoolMask(list=filterByBoolMask_2.in, mask=flatten)
string_3 = StringInput("Air_Flow Rate")
string_4 = StringInput("Specified Supply Airflow")
getParameterValueByName_2 = Element.GetParameterValueByName(element=filterByBoolMask.in, parameterName=string_4)
count = Count(filterByBoolMask_3.in)
div = getParameterValueByName_2 / count
setParameterByName = Element.SetParameterByName(element=filterByBoolMask_3.in, parameterName=string_3, value=div, lacing=Longest)
string_5 = StringInput("Return Air")
containsItem_2 = List.ContainsItem(list=getParameterValueByName, item=string_5, lacing=Longest)
flatten_2 = Flatten(containsItem_2)
filterByBoolMask_4 = List.FilterByBoolMask(list=filterByBoolMask_2.in, mask=flatten_2)
string_6 = StringInput("Air_Flow Rate")
string_7 = StringInput("Specified Return Airflow")
getParameterValueByName_3 = Element.GetParameterValueByName(element=filterByBoolMask.in, parameterName=string_7)
count_2 = Count(filterByBoolMask_4.in)
div_2 = getParameterValueByName_3 / count_2
setParameterByName_2 = Element.SetParameterByName(element=filterByBoolMask_4.in, parameterName=string_6, value=div_2, lacing=Longest)
string_8 = StringInput("Exhaust Air")
containsItem_3 = List.ContainsItem(list=getParameterValueByName, item=string_8, lacing=Longest)
flatten_3 = Flatten(containsItem_3)
filterByBoolMask_5 = List.FilterByBoolMask(list=filterByBoolMask_2.in, mask=flatten_3)
string_9 = StringInput("Air_Flow Rate")
string_10 = StringInput("Specified Exhaust Airflow")
getParameterValueByName_4 = Element.GetParameterValueByName(element=filterByBoolMask.in, parameterName=string_10)
count_3 = Count(filterByBoolMask_5.in)
div_3 = getParameterValueByName_4 / count_3
setParameterByName_3 = Element.SetParameterByName(element=filterByBoolMask_5.in, parameterName=string_9, value=div_3, lacing=Longest)
string_11 = StringInput("Identity_Reference")
string_12 = StringInput("Name")
getParameterValueByName_5 = Element.GetParameterValueByName(element=filterByBoolMask.in, parameterName=string_12)
string_13 = StringInput("System Classification")
getParameterValueByName_6 = Element.GetParameterValueByName(element=filterByBoolMask_3.in, parameterName=string_13)
number = DoubleInput(1)
number_range = NumberRange(number, count, number, lacing=Longest)
code_block = CodeBlock(a=getParameterValueByName_6, b=number_range) { " - "+a+" - "+b; }
add = getParameterValueByName_5 + code_block  # lacing=Longest
setParameterByName_4 = Element.SetParameterByName(element=filterByBoolMask_3.in, parameterName=string_11, value=add)
string_14 = StringInput("System Classification")
getParameterValueByName_7 = Element.GetParameterValueByName(element=filterByBoolMask_4.in, parameterName=string_14)
number_2 = DoubleInput(1)
number_range_2 = NumberRange(number_2, count_2, number_2, lacing=Longest)
code_block_2 = CodeBlock(a=getParameterValueByName_7, b=number_range_2) { " - "+a+" - "+b; }
add_2 = getParameterValueByName_5 + code_block_2  # lacing=Longest
string_15 = StringInput("System Classification")
getParameterValueByName_8 = Element.GetParameterValueByName(element=filterByBoolMask_5.in, parameterName=string_15)
number_3 = DoubleInput(1)
number_range_3 = NumberRange(number_3, count_3, number_3, lacing=Longest)
code_block_3 = CodeBlock(a=getParameterValueByName_8, b=number_range_3) { " - "+a+" - "+b; }
add_3 = getParameterValueByName_5 + code_block_3  # lacing=Longest
categories_3 = Categories("MechanicalEquipment")
isOfCategory_3 = Custom[Element.IsOfCategory](element=select_model_elements, category=categories_3)
filterByBoolMask_6 = List.FilterByBoolMask(list=select_model_elements, mask=isOfCategory_3)
string_16 = StringInput("Water_Flow Rate_Cooling")
string_17 = StringInput("NPH_Space_M_Cooling_Water_Flowrate")
getParameterValueByName_9 = Element.GetParameterValueByName(element=filterByBoolMask.in, parameterName=string_17)
setParameterByName_5 = Element.SetParameterByName(element=filterByBoolMask_6.in, parameterName=string_16, value=getParameterValueByName_9, lacing=Longest)
categories_4 = Categories("MechanicalEquipment")
isOfCategory_4 = Custom[Element.IsOfCategory](element=select_model_elements, category=categories_4)
filterByBoolMask_7 = List.FilterByBoolMask(list=select_model_elements, mask=isOfCategory_4)
string_18 = StringInput("Water_Flow Rate_Heating")
string_19 = StringInput("NPH_Space_M_Heating_Water_Flowrate")
getParameterValueByName_10 = Element.GetParameterValueByName(element=filterByBoolMask.in, parameterName=string_19)
setParameterByName_6 = Element.SetParameterByName(element=filterByBoolMask_7.in, parameterName=string_18, value=getParameterValueByName_10, lacing=Longest)
watch = Watch(select_model_elements)
