# Dynamo graph NPH_Convert W load to l per s.dyn (Dynamo 0.8.2.2392)

categories = Categories("MEPSpaces")
all_elements_of_category = ElementsOfCategory(categories)
watch = Watch(all_elements_of_category)
code_block = CodeBlock { "NPH_Space_M_Cooling_Load_Total"; "NPH_Space_M_Heating_Load_Total"; "Number"; }
getParameterValueByName = Element.GetParameterValueByName(element=all_elements_of_category, parameterName=code_block.out2)
cooling_load = Element.GetParameterValueByName(element=all_elements_of_category, parameterName=code_block.out0)
conversion_units = CodeBlock { "no conversion"; 1; "from W to ??"; 10.7639; "from m3/s to ft3/s"; 35.31; "from l/s to ??"; }
mul = cooling_load * conversion_units.out3
code_block_2 = CodeBlock { "NPH_Space_M_Cooling_Water_Flowrate"; "NPH_Space_M_Heating_Water_Flowrate"; }
div = cooling_load / conversion_units.out3
code_block_3 = CodeBlock { 1; 4180; 6; }
code_block_4 = CodeBlock(density=code_block_3.out0, cp=code_block_3.out1, incT=code_block_3.out2) { divide=density*cp*incT; }
div_2 = div / code_block_4
conversion_units_2 = CodeBlock { "no conversion"; 1; "from W to ??"; 10.76; "from m3/s to ft3/s"; 35.31; "from l/s to ??"; 0.0353; }
mul_2 = div_2 * conversion_units_2.out7
setParameterByName = Element.SetParameterByName(element=all_elements_of_category, parameterName=code_block_2.out0, value=mul_2)
heating_load = Element.GetParameterValueByName(element=all_elements_of_category, parameterName=code_block.out1)
conversion_units_3 = CodeBlock { "no conversion"; 1; "from W to ??"; 10.76; "from m3/s to ft3/s"; 35.31; "from l/s to ??"; }
div_3 = heating_load / conversion_units_3.out3
code_block_5 = CodeBlock { 1; 4180; 20; }
code_block_6 = CodeBlock(density=code_block_5.out0, cp=code_block_5.out1, incT=code_block_5.out2) { divide=density*cp*incT; }
div_4 = div_3 / code_block_6
conversion_units_4 = CodeBlock { "no conversion"; 1; "from W to ??"; 10.76; "from m3/s to ft3/s"; 35.31; "from l/s to ??"; 0.0353; }
mul_3 = div_4 * conversion_units_4.out7
setParameterByName_2 = Element.SetParameterByName(element=all_elements_of_category, parameterName=code_block_2.out1, value=mul_3)
mul_4 = cooling_load * conversion_units_3.out3
