# Dynamo graph NPH_M_airflow to ACH for checks.dyn (Dynamo 0.8.2.2392)

# group: to check a space
categories = Categories("MEPSpaces")
all_elements_of_category = ElementsOfCategory(categories)
code_block = CodeBlock { "NPH_Space_M_Air_Return_ACH"; }
code_block_2 = CodeBlock { "Specified Supply Airflow"; "Specified Return Airflow"; "Volume"; "Number"; }
getParameterValueByName = Element.GetParameterValueByName(element=all_elements_of_category, parameterName=code_block_2.out1)
code_block_3 = CodeBlock { 101.95; }
mul = getParameterValueByName * code_block_3
getParameterValueByName_2 = Element.GetParameterValueByName(element=all_elements_of_category, parameterName=code_block_2.out2)
div = mul / getParameterValueByName_2
round = Math.Round(div)
setParameterByName = Element.SetParameterByName(element=all_elements_of_category, parameterName=code_block, value=round)
code_block_4 = CodeBlock { "NPH_Space_M_Air_Supply_ACH"; }
getParameterValueByName_3 = Element.GetParameterValueByName(element=all_elements_of_category, parameterName=code_block_2.out0)
code_block_5 = CodeBlock { 101.95; }
mul_2 = getParameterValueByName_3 * code_block_5
div_2 = mul_2 / getParameterValueByName_2
round_2 = Math.Round(div_2)
setParameterByName_2 = Element.SetParameterByName(element=all_elements_of_category, parameterName=code_block_4, value=round_2)
getParameterValueByName_4 = Element.GetParameterValueByName(element=all_elements_of_category, parameterName=code_block_2.out3)
code_block_6 = CodeBlock { "L05-IPA-CIR-C001-01"; }
firstIndexOf = List.FirstIndexOf(list=getParameterValueByName_4, item=code_block_6)
ach_ret = List.GetItemAtIndex(list=round, index=firstIndexOf)
ach = Watch(ach_ret)
specified_return_airflow = List.GetItemAtIndex(list=getParameterValueByName, index=firstIndexOf)
conversion_units = CodeBlock { "no conversion"; 1; "from W to ??"; 10.7639; "from m3/s to ft3/s"; 35.31; }
div_3 = specified_return_airflow / conversion_units.out5
return_ = Watch(div_3)
ach_supp = List.GetItemAtIndex(list=round_2, index=firstIndexOf)
ach_2 = Watch(ach_supp)
specified_supply_airflow = List.GetItemAtIndex(list=getParameterValueByName_3, index=firstIndexOf)
div_4 = specified_supply_airflow / conversion_units.out5
supply = Watch(div_4)
