# Dynamo graph NPH_GEN_CopyElementParameters.dyn (Dynamo 0.8.2.2392)

item_to_paste_parameters_values = DSModelElementSelection()  # 1 picked in the model
item_to_copy_values = DSModelElementSelection()  # 1 picked in the model
parameters = Element.Parameters(item_to_copy_values)
name = Parameter.Name(parameters)
code_block = CodeBlock { "NPH"; }
contains = String.Contains(str=name, searchFor=code_block)
filterByBoolMask = List.FilterByBoolMask(list=name, mask=contains)
getParameterValueByName = Element.GetParameterValueByName(element=item_to_copy_values, parameterName=filterByBoolMask.in)
setParameterByName = Element.SetParameterByName(element=item_to_paste_parameters_values, parameterName=filterByBoolMask.in, value=getParameterValueByName)
