# Dynamo graph NPH_M_SpacesInfo.dyn (Dynamo 0.8.2.2392)

file_path = Filename("\\global\europe\Dublin\Jobs\237000\237976-00\4. Internal\4-02 Drawings\4-02-20 Revit\18 Dynamo\SpacesInfo\NPH_M_SpacesInfo.xlsx")
code_block = CodeBlock { "WD"; "FN"; "FS"; 0; }

# group: Name of teh parameter you want to obtain
code_block_2 = CodeBlock()
# ---------- code_block_2.designscript (10 lines) ----------
"NPH_Space_M_Heating_Type";
"Number";
"Name";
"ElementID";
"NPH_Space_GEN_RoofArea";
"NPH_Space_M_Ventilation_Type";
"NPH_Space_M_AHU_Ref";
"Level";
"NPH_Space_M_EF_Ref";
"NPH_Space_GEN_Room_Ceiling_Height";
# ----------------------------------------

categories = Categories("MEPSpaces")
all_elements_of_category = ElementsOfCategory(categories)
getParameterValueByName = Element.GetParameterValueByName(element=all_elements_of_category, parameterName=code_block_2.out0)
addItemToFront = List.AddItemToFront(item=code_block_2.out0, list=getParameterValueByName)
getParameterValueByName_2 = Element.GetParameterValueByName(element=all_elements_of_category, parameterName=code_block_2.out1)
addItemToFront_2 = List.AddItemToFront(item=code_block_2.out1, list=getParameterValueByName_2)
getParameterValueByName_3 = Element.GetParameterValueByName(element=all_elements_of_category, parameterName=code_block_2.out2)
addItemToFront_3 = List.AddItemToFront(item=code_block_2.out2, list=getParameterValueByName_3)
id = Element.Id(all_elements_of_category)
addItemToFront_4 = List.AddItemToFront(item=code_block_2.out3, list=id)
getParameterValueByName_4 = Element.GetParameterValueByName(element=all_elements_of_category, parameterName=code_block_2.out4)
addItemToFront_5 = List.AddItemToFront(item=code_block_2.out4, list=getParameterValueByName_4)
getParameterValueByName_5 = Element.GetParameterValueByName(element=all_elements_of_category, parameterName=code_block_2.out5)
addItemToFront_6 = List.AddItemToFront(item=code_block_2.out5, list=getParameterValueByName_5)
getParameterValueByName_6 = Element.GetParameterValueByName(element=all_elements_of_category, parameterName=code_block_2.out6)
addItemToFront_7 = List.AddItemToFront(item=code_block_2.out6, list=getParameterValueByName_6)
getParameterValueByName_7 = Element.GetParameterValueByName(element=all_elements_of_category, parameterName=code_block_2.out7)
addItemToFront_8 = List.AddItemToFront(item=code_block_2.out7, list=getParameterValueByName_7)
getParameterValueByName_8 = Element.GetParameterValueByName(element=all_elements_of_category, parameterName=code_block_2.out8)
addItemToFront_9 = List.AddItemToFront(item=code_block_2.out8, list=getParameterValueByName_8)
getParameterValueByName_9 = Element.GetParameterValueByName(element=all_elements_of_category, parameterName=code_block_2.out9)
addItemToFront_10 = List.AddItemToFront(item=code_block_2.out9, list=getParameterValueByName_9)
create = List.Create(addItemToFront, addItemToFront_2, addItemToFront_3, addItemToFront_4, addItemToFront_5, addItemToFront_6, addItemToFront_7, addItemToFront_8, addItemToFront_9, addItemToFront_10)
transpose = List.Transpose(create)
writeToFile = Excel.WriteToFile(filePath=file_path, sheetName=code_block.out1, startRow=code_block.out3, startCol=code_block.out3, data=transpose)
