# Dynamo graph NPH_M_Spaces_RoofParameterFill.dyn (Dynamo 0.8.2.2392)

# group: Select the area with spaces that have a roof.
select_model_elements = DSModelElementsSelection()  # 651 picked in the model

watch = Watch(select_model_elements)
string_from_object = FromObject(select_model_elements)
code_block = CodeBlock { "Space"; true; }
contains = String.Contains(str=string_from_object, searchFor=code_block.out0, ignoreCase=code_block.out1)
filterByBoolMask = List.FilterByBoolMask(list=select_model_elements, mask=contains)
code_block_2 = CodeBlock { "NPH_Space_GEN_RoofArea"; }
code_block_3 = CodeBlock { "Area"; }
getParameterValueByName = Element.GetParameterValueByName(element=filterByBoolMask.in, parameterName=code_block_3)
element_setparameterbyname_case = Custom[Element.SetParameterByName(CaSe iNSeNSiTiVe)](element=filterByBoolMask.in, parameterName=code_block_2, value=getParameterValueByName)  # Set one of the element's parameters. (CaSe iNSeNSiTiVe)
