# Dynamo graph NPH_M_Spaces_fillInParameters.dyn (Dynamo 0.8.2.2392)

categories = Categories("MEPSpaces")
all_elements_of_category = ElementsOfCategory(categories)
code_block = CodeBlock { "Number"; }
getParameterValueByName = Element.GetParameterValueByName(element=all_elements_of_category, parameterName=code_block)
file_path = Filename("\\global\europe\Dublin\Jobs\237000\237976-00\4. Internal\4-02 Drawings\4-02-20 Revit\18 Dynamo\Walls-Facades\RAW_Walls-facades-curtainwall.xlsx")
code_block_2 = CodeBlock { true; "All floors"; "D19"; "H1110"; }
read_excel = Custom[Read Excel](File_Path=file_path, RunIt=code_block_2.out0, SheetName=code_block_2.out1, ByColumn=code_block_2.out0, Origin=code_block_2.out2, Extent=code_block_2.out3)  # This node will read an excel file. You can read an entore sheet contents, read from specific origin cell, read only specific range, or do all of the former for multiple sheets at the same time.
code_block_3 = CodeBlock(A=read_excel) { A[0]; }
code_block_4 = CodeBlock(A=read_excel) { A[4]; }
code_block_5 = CodeBlock { null; ""; }
ne = code_block_4 != code_block_5.out0
ne_2 = code_block_4 != code_block_5.out1
and_ = ne && ne_2
filterByBoolMask = List.FilterByBoolMask(list=code_block_3, mask=and_)
firstIndexOf = List.FirstIndexOf(list=getParameterValueByName, item=filterByBoolMask.in)
getItemAtIndex = List.GetItemAtIndex(list=all_elements_of_category, index=firstIndexOf)
code_block_6 = CodeBlock { "NPH_Space_GEN_CurtainWallOrientation"; }
filterByBoolMask_2 = List.FilterByBoolMask(list=code_block_4, mask=and_)
element_setparameterbyname_case = Custom[Element.SetParameterByName(CaSe iNSeNSiTiVe)](element=getItemAtIndex, parameterName=code_block_6, value=filterByBoolMask_2.in)  # Set one of the element's parameters. (CaSe iNSeNSiTiVe)
