# Dynamo graph NPH_M_Spaces_fillInSupplyExtractDExtractAir.dyn (Dynamo 0.8.2.2392)

code_block = CodeBlock { "Column titles"; }

# group: 1
file_path_wards = Filename("\\global\europe\Dublin\Jobs\237000\237976-00\4. Internal\4-03 Design\4-03-01 Buildings\Mechanical\01 HVAC Design Files\HVAC Design File-WD-MAD.xlsx")
code_block_2 = CodeBlock { true; "Room Data"; 0; "r25"; "ab5000"; "Vent - Rooms"; }
titles_of_columns_to_import = CodeBlock { "r19"; "ab19"; false; }
space_number = CodeBlock { "B25"; "B5000"; }

read_excel = Custom[Read Excel](File_Path=file_path_wards, RunIt=code_block_2.out0, SheetName=code_block_2.out5, ByColumn=titles_of_columns_to_import.out2, Origin=titles_of_columns_to_import.out0, Extent=titles_of_columns_to_import.out1)  # This node will read an excel file. You can read an entore sheet contents, read from specific origin cell, read only specific range, or do all of the former for multiple sheets at the same time.
flatten = Flatten(read_excel)
addItemToFront = List.AddItemToFront(item=code_block, list=flatten)
categories = Categories("MEPSpaces")
all_elements_of_category = ElementsOfCategory(categories)
code_block_3 = CodeBlock { "Number"; }
getParameterValueByName = Element.GetParameterValueByName(element=all_elements_of_category, parameterName=code_block_3)
read_excel_2 = Custom[Read Excel](File_Path=file_path_wards, RunIt=code_block_2.out0, SheetName=code_block_2.out5, ByColumn=code_block_2.out0, Origin=space_number.out0, Extent=space_number.out1)
read_excel_3 = Custom[Read Excel](File_Path=file_path_wards, RunIt=code_block_2.out0, SheetName=code_block_2.out5, ByColumn=code_block_2.out0, Origin=code_block_2.out3, Extent=code_block_2.out4)
create = List.Create(read_excel_2, read_excel_3)
code_block_4 = CodeBlock { 1; }
flatten_2 = List.Flatten(list=create, amt=code_block_4)

# group: 2 Select index of value to import See rect 4 below
watch = Watch(addItemToFront)
select_index_of_value_to_import = CodeBlock { "Index of value to import - Extract"; 4; "AHU system column"; 2; "Index of value to import - Supply"; 7; }
name_of_ahu_to_fill_data_for = CodeBlock(AHUs=flatten_2, columntitle=select_index_of_value_to_import.out3) { AHUs[columntitle]; "AHU/HP/WD/07/004"; }

string_from_object = FromObject(name_of_ahu_to_fill_data_for.out0)
contains = String.Contains(str=string_from_object, searchFor=name_of_ahu_to_fill_data_for.out1)
code_block_5 = CodeBlock { false; }
replaceNull = Custom[List.ReplaceNull](list=contains, replacement=code_block_5)  # Replaces all null values within a given list with a substitute
filterByBoolMask = List.FilterByBoolMask(mask=replaceNull)
map = List.Map(list=flatten_2, f_x=filterByBoolMask.in)
code_block_6 = CodeBlock(VentRooms=map) { VentRooms[0]; }
firstIndexOf = List.FirstIndexOf(list=getParameterValueByName, item=code_block_6)
getItemAtIndex = List.GetItemAtIndex(list=all_elements_of_category, index=firstIndexOf)
deconstruct = List.Deconstruct(list=all_elements_of_category)
parameters = Element.Parameters(deconstruct.first)
name = Parameter.Name(parameters)
code_block_7 = CodeBlock { "NPH_"; }
contains_2 = String.Contains(str=name, searchFor=code_block_7)
filterByBoolMask_2 = List.FilterByBoolMask(list=name, mask=contains_2)

# group: 4 Disconnect "parameter selected" node at end of this square. Then run to select parameter value and fill square 2, then connect item node to parameter name!!
sort = List.Sort(filterByBoolMask_2.in)
watch_2 = Watch(sort)
select_parameter_to_be_filled = CodeBlock { "DE"; 43; "RA"; 45; "SA"; 47; }
getItemAtIndex_2 = List.GetItemAtIndex(list=watch_2, index=select_parameter_to_be_filled.out1)
getItemAtIndex_3 = List.GetItemAtIndex(list=watch_2, index=select_parameter_to_be_filled.out3)
getItemAtIndex_4 = List.GetItemAtIndex(list=watch_2, index=select_parameter_to_be_filled.out5)

code_block_8 = CodeBlock { 0; }
code_block_9 = CodeBlock(VentRooms=map, columnTitle=select_index_of_value_to_import.out1) { VentRooms[columnTitle]; }
conversion_units = CodeBlock { "no conversion"; 1; "from W to ??"; 10.7639; "from m3/s to ft3/s"; 35.31; }
mul = code_block_9 * conversion_units.out5
getItemAtIndex_5 = List.GetItemAtIndex(list=getParameterValueByName, index=firstIndexOf)
firstIndexOf_2 = List.FirstIndexOf(list=code_block_6, item=getItemAtIndex_5)
getItemAtIndex_6 = List.GetItemAtIndex(list=mul, index=firstIndexOf_2)
count = Count(getItemAtIndex_6)
ofRepeatedItem = List.OfRepeatedItem(item=code_block_8, amount=count)
watch_3 = Watch(name_of_ahu_to_fill_data_for.out0)
code_block_10 = CodeBlock(VentRooms=map, columnTitle=select_index_of_value_to_import.out5) { VentRooms[columnTitle]; }
conversion_units_2 = CodeBlock { "no conversion"; 1; "from W to ??"; 10.7639; "from m3/s to ft3/s"; 35.31; }
mul_2 = code_block_10 * conversion_units_2.out5
firstIndexOf_3 = List.FirstIndexOf(list=code_block_6, item=getItemAtIndex_5)
getItemAtIndex_7 = List.GetItemAtIndex(list=mul_2, index=firstIndexOf_3)
code_block_11 = CodeBlock { "Specified Exhaust Airflow"; }

# group: DE
setParameterByName = Element.SetParameterByName(element=getItemAtIndex, parameterName=getItemAtIndex_2, value=ofRepeatedItem)
setParameterByName_2 = Element.SetParameterByName(element=getItemAtIndex, parameterName=code_block_11, value=ofRepeatedItem)

code_block_12 = CodeBlock { "Specified Return Airflow"; }

# group: RA
setParameterByName_3 = Element.SetParameterByName(element=getItemAtIndex, parameterName=getItemAtIndex_3, value=getItemAtIndex_6)
setParameterByName_4 = Element.SetParameterByName(element=getItemAtIndex, parameterName=code_block_12, value=getItemAtIndex_6)

code_block_13 = CodeBlock { "Specified Supply Airflow"; }

# group: SA
setParameterByName_5 = Element.SetParameterByName(element=getItemAtIndex, parameterName=getItemAtIndex_4, value=getItemAtIndex_7)
setParameterByName_6 = Element.SetParameterByName(element=getItemAtIndex, parameterName=code_block_13, value=getItemAtIndex_7)

file_path_sf = Filename("\\global\europe\Dublin\Jobs\237000\237976-00\4. Internal\4-03 Design\4-03-01 Buildings\Mechanical\01 HVAC Design Files\HVAC Design File-SF-MAD.xlsx")
code_block_14 = CodeBlock { "Volume"; }
getParameterValueByName_2 = Element.GetParameterValueByName(element=all_elements_of_category, parameterName=code_block_14)
getItemAtIndex_8 = List.GetItemAtIndex(list=getParameterValueByName_2, index=firstIndexOf)
file_path_nf = Filename("\\global\europe\Dublin\Jobs\237000\237976-00\4. Internal\4-03 Design\4-03-01 Buildings\Mechanical\01 HVAC Design Files\HVAC Design File-NF-MAD.xlsx")
