# Dynamo graph NPH_M_Spaces_param from Excel to Revit_pp.dyn (Dynamo 0.8.2.2392)

code_block = CodeBlock { "Column titles"; }

# group: 1
file_path = Filename("\\global\europe\Dublin\Jobs\237000\237976-00\4. Internal\4-03 Design\4-03-01 Buildings\Mechanical\01 HVAC Design Files\HVAC Design File-LLG-DUB.xlsx")
code_block_2 = CodeBlock { true; "Pipework Flows"; 0; "b2"; "d500"; }
titles_of_columns_to_import = CodeBlock { "b2"; "d2"; false; }
space_number = CodeBlock { "b2"; "b500"; }

read_excel = Custom[Read Excel](File_Path=file_path, RunIt=code_block_2.out0, SheetName=code_block_2.out1, ByColumn=titles_of_columns_to_import.out2, Origin=titles_of_columns_to_import.out0, Extent=titles_of_columns_to_import.out1)  # This node will read an excel file. You can read an entore sheet contents, read from specific origin cell, read only specific range, or do all of the former for multiple sheets at the same time.
flatten = Flatten(read_excel)
addItemToFront = List.AddItemToFront(item=code_block, list=flatten)

# group: 2 Select index of value to import See rect 4 below
watch = Watch(addItemToFront)
select_index_of_value_to_import = CodeBlock { 2; }

categories = Categories("MEPSpaces")
all_elements_of_category = ElementsOfCategory(categories)
deconstruct = List.Deconstruct(list=all_elements_of_category)
parameters = Element.Parameters(deconstruct.first)
name = Parameter.Name(parameters)
code_block_3 = CodeBlock { "NPH_"; }
contains = String.Contains(str=name, searchFor=code_block_3)
filterByBoolMask = List.FilterByBoolMask(list=name, mask=contains)
sort = List.Sort(filterByBoolMask.in)

# group: 4 Disconnect "parameter selected" node at end of this square. Then run to select parameter value and fill square 2, then connect item node to parameter name!!
watch_2 = Watch(sort)
select_parameter_to_be_filled = CodeBlock { 41; }
getItemAtIndex = List.GetItemAtIndex(list=watch_2, index=select_parameter_to_be_filled)

read_excel_2 = Custom[Read Excel](File_Path=file_path, RunIt=code_block_2.out0, SheetName=code_block_2.out1, ByColumn=code_block_2.out0, Origin=space_number.out0, Extent=space_number.out1)
read_excel_3 = Custom[Read Excel](File_Path=file_path, RunIt=code_block_2.out0, SheetName=code_block_2.out1, ByColumn=code_block_2.out0, Origin=code_block_2.out3, Extent=code_block_2.out4)
create = List.Create(read_excel_2, read_excel_3)
code_block_4 = CodeBlock { 1; }
flatten_2 = List.Flatten(list=create, amt=code_block_4)

# group: 3 does the parameter needs conversion?
code_block_5 = CodeBlock(VentRooms=flatten_2, columnTitle=select_index_of_value_to_import) { VentRooms[columnTitle]; }
conversion_units = CodeBlock { "no conversion"; 1; "from W to ??"; 10.7639; "from m3/s to ft3/s"; 35.31; "from l/s to ft3/s"; 0.03531; }
mul = code_block_5 * conversion_units.out7

code_block_6 = CodeBlock(VentRooms=flatten_2) { VentRooms[0]; }
code_block_7 = CodeBlock { "Number"; }
getParameterValueByName = Element.GetParameterValueByName(element=all_elements_of_category, parameterName=code_block_7)
firstIndexOf = List.FirstIndexOf(list=code_block_6, item=getParameterValueByName)
getItemAtIndex_2 = List.GetItemAtIndex(list=mul, index=firstIndexOf)
setParameterByName = Element.SetParameterByName(element=all_elements_of_category, parameterName=getItemAtIndex, value=getItemAtIndex_2)
code_block_8 = CodeBlock { "L06-IPA-GW6-S093-01"; }
firstIndexOf_2 = List.FirstIndexOf(list=getParameterValueByName, item=code_block_8)
code_block_9 = CodeBlock { "L06-IPA-GW6-S093-01"; }
firstIndexOf_3 = List.FirstIndexOf(list=code_block_6, item=code_block_9)
