# Dynamo graph NPH_M_Spaces_param from Revit to Excel.dyn (Dynamo 0.8.2.2392)

file_path = Filename("\\global\europe\Dublin\Jobs\237000\237976-00\4. Internal\4-02 Drawings\4-02-20 Revit\18 Dynamo\Walls-Facades\RAW_Walls-facades-curtainwall.xlsx")
code_block = CodeBlock { "NPH_Space_GEN_CurtainWallOrientation"; "WDorientation"; }
code_block_2 = CodeBlock { true; "All floors"; 0; }
categories = Categories("MEPSpaces")
all_elements_of_category = ElementsOfCategory(categories)
code_block_3 = CodeBlock { "Number"; }
getParameterValueByName = Element.GetParameterValueByName(element=all_elements_of_category, parameterName=code_block_3)
getParameterValueByName_2 = Element.GetParameterValueByName(element=all_elements_of_category, parameterName=code_block.out0)
code_block_4 = CodeBlock { ""; }
ne = getParameterValueByName_2 != code_block_4
filterByBoolMask = List.FilterByBoolMask(list=getParameterValueByName, mask=ne)
filterByBoolMask_2 = List.FilterByBoolMask(list=getParameterValueByName_2, mask=ne)
create = List.Create(filterByBoolMask.in, filterByBoolMask_2.in)
transpose = List.Transpose(create)
writeToFile = Excel.WriteToFile(filePath=file_path, sheetName=code_block.out1, startRow=code_block_2.out2, startCol=code_block_2.out2, data=transpose)
filterByBoolMask_3 = List.FilterByBoolMask(list=all_elements_of_category, mask=ne)
