# Dynamo graph Walls_NPH-Check.dyn (Dynamo 0.8.2.2392)

# group: Select excel sheet with information from Dynamo about walls so the area value is filled in the space parameter
file_path = Filename("\\global\europe\Dublin\Jobs\237000\237976-00\4. Internal\4-02 Drawings\4-02-20 Revit\18 Dynamo\Walls-Facades\RAW_Walls-facades.xlsx")
code_block = CodeBlock { true; "summary"; "E4"; "F4"; "F1700"; }

read_excel = Custom[Read Excel](File_Path=file_path, RunIt=code_block.out0, SheetName=code_block.out1, ByColumn=code_block.out0, Origin=code_block.out2, Extent=code_block.out4)  # This node will read an excel file. You can read an entore sheet contents, read from specific origin cell, read only specific range, or do all of the former for multiple sheets at the same time.
flatten = Flatten(read_excel)

# group: Selects all spaces from model
categories = Categories("MEPSpaces")
all_elements_of_category = ElementsOfCategory(categories)
code_block_2 = CodeBlock { "Number"; }
getParameterValueByName = Element.GetParameterValueByName(element=all_elements_of_category, parameterName=code_block_2)

code_block_3 = CodeBlock(a=read_excel) { a[0]; a[1]; }
string_from_object = FromObject(getParameterValueByName)
firstIndexOf = List.FirstIndexOf(list=code_block_3.out0, item=string_from_object)
code_block_4 = CodeBlock { -1; }
eq = firstIndexOf == code_block_4
filterByBoolMask = List.FilterByBoolMask(list=all_elements_of_category, mask=eq)
code_block_5 = CodeBlock { "NPH_Space_GEN_FaçadeCheck"; }
getItemAtIndex = List.GetItemAtIndex(list=code_block_3.out1, index=firstIndexOf)
filterByBoolMask_2 = List.FilterByBoolMask(list=getItemAtIndex, mask=eq)
setParameterByName = Element.SetParameterByName(element=filterByBoolMask.out, parameterName=code_block_5, value=filterByBoolMask_2.out)
code_block_6 = CodeBlock { "L02-IPA-GW9-S072-01"; }
firstIndexOf_2 = List.FirstIndexOf(list=getParameterValueByName, item=code_block_6)
firstIndexOf_3 = List.FirstIndexOf(list=code_block_3.out0, item=code_block_6)
code_block_7 = CodeBlock { 0; }
setParameterByName_2 = Element.SetParameterByName(element=filterByBoolMask.in, parameterName=code_block_5, value=code_block_7)
