# Dynamo graph Walls_NPH-with detail lines_curtainWall_orientation.dyn (Dynamo 0.8.2.2392)

# group: insert name of the style of your detail lines
code_block = CodeBlock { "NPH_Façade_Line_CurtainWall"; true; }

# group: get detail lines and draw them
getLineStyleByName = Custom[Tool.GetLineStyleByName](Ignore_Case_boolean=code_block.out1, Contains_String=code_block.out0)  # Collects LineStyle from string.contains
categories = Categories("Lines")
all_elements_of_category = ElementsOfCategory(categories)
typeName = Custom[Element.TypeName]()  # Get Type Name as string
map = List.Map(list=all_elements_of_category, f_x=typeName)
code_block_2 = CodeBlock { "Detail"; true; }
contains = String.Contains(str=map, searchFor=code_block_2.out0, ignoreCase=code_block_2.out1)
filterByBoolMask = List.FilterByBoolMask(list=all_elements_of_category, mask=contains)
code_block_3 = CodeBlock { "Line Style"; }
getParameterValueByName = Element.GetParameterValueByName(element=filterByBoolMask.in, parameterName=code_block_3)
id = Element.Id(getParameterValueByName)
element_types = ElementTypes("GraphicsStyle")
all_elements_of_type = ElementsOfType(element_types)
filterByName = Custom[Elements.FilterByName](Elements=all_elements_of_type, Search_string=code_block.out0, Ignore_case=code_block.out1)  # Retrieves those elements from a collection whose names match the search string
id_2 = Element.Id(filterByName.first)
code_block_4 = CodeBlock(a=id, b=id_2) { a==b; }
filterByBoolMask_2 = List.FilterByBoolMask(list=filterByBoolMask.in, mask=code_block_4)
geometry = Element.Geometry(filterByBoolMask_2.in)

flatten = Flatten(geometry)

# group: Select the floors to be drawn and takes the maximum height
add_manual_height_of_façade = CodeBlock { 0; "select value or override below by"; 2700; }
levels = Levels("L01")
elevation = Level.Elevation(levels)
levels_2 = Levels("00")
elevation_2 = Level.Elevation(levels_2)
sub = elevation - elevation_2
levels_3 = Levels("L02")
elevation_3 = Level.Elevation(levels_3)
sub_2 = elevation_3 - elevation
levels_4 = Levels("L03")
elevation_4 = Level.Elevation(levels_4)
sub_3 = elevation_4 - elevation_3
create = List.Create(sub, sub_2, sub_3)
or_select_heigh_of_level_from = List.MaximumItem(create)  # "OR SELECT HEIGH OF LEVEL FROM MODEL"

byCoordinates = Vector.ByCoordinates(z=add_manual_height_of_façade.out2)

# group: draws walls from your detail lines and intersects with spaces
extrude = Curve.Extrude(curve=flatten, distance=byCoordinates)

thicken = Surface.Thicken(surface=extrude)
flatten_2 = Flatten(thicken)

# group: brings spaces and intersects them with the drawn wall
categories_2 = Categories("MEPSpaces")
all_elements_of_category_2 = ElementsOfCategory(categories_2)
geometry_2 = Element.Geometry(all_elements_of_category_2)
doesIntersect = Geometry.DoesIntersect(geometry=geometry_2, other=flatten_2, lacing=CrossProduct)
id_3 = Element.Id(all_elements_of_category_2)

countTrue = CountTrue(doesIntersect)

# group: Select excel file to save data AND tab name where to save the data
file_path = Filename("\\global\europe\Dublin\Jobs\237000\237976-00\4. Internal\4-02 Drawings\4-02-20 Revit\18 Dynamo\Walls-Facades\RAW_Walls-facades-curtainwall.xlsx")
select_a_name_to_tab_from_below = CodeBlock { "WD"; "FN"; "FS"; "HB"; "-"; }

code_block_5 = CodeBlock { 0; false; }
flatten_3 = Flatten()
map_2 = List.Map(list=doesIntersect, f_x=flatten_3)
code_block_6 = CodeBlock { true; }
contains_2 = Custom[List.Contains](list=map_2, item=code_block_6)  # Determines if the given list contains the item or items.
filterByBoolMask_3 = List.FilterByBoolMask(list=all_elements_of_category_2, mask=contains_2)
code_block_7 = CodeBlock { "Number"; }
getParameterValueByName_2 = Element.GetParameterValueByName(element=filterByBoolMask_3.in, parameterName=code_block_7)
filterByBoolMask_4 = List.FilterByBoolMask(list=id_3, mask=contains_2)
create_2 = List.Create(getParameterValueByName_2, filterByBoolMask_4.in)
transpose = List.Transpose(create_2)
code_block_8 = CodeBlock { 0.5; }
normalAtParameter = Surface.NormalAtParameter(surface=extrude, u=code_block_8, v=code_block_8)
filterByBoolMask_5 = List.FilterByBoolMask(list=map_2, mask=contains_2)
count = Count(filterByBoolMask_5.in)
ofRepeatedItem = List.OfRepeatedItem(item=normalAtParameter, amount=count)
filterByBoolMask_6 = List.FilterByBoolMask(list=ofRepeatedItem, mask=filterByBoolMask_5.in)
create_3 = List.Create(transpose, filterByBoolMask_6.in)
transpose_2 = List.Transpose(create_3)
code_block_9 = CodeBlock { 1; }
flatten_4 = List.Flatten(list=transpose_2, amt=code_block_9)
writeToFile = Excel.WriteToFile(filePath=file_path, sheetName=select_a_name_to_tab_from_below.out0, startRow=code_block_5.out0, startCol=code_block_5.out0, data=flatten_4, overWrite=code_block_5.out1)
watch = Watch(all_elements_of_category)
