# Dynamo graph Walls_NPH-with detail lines_curtainWall_partial runs-l04.dyn (Dynamo 0.8.2.2392)

# group: insert name of the style of your detail lines
code_block = CodeBlock { "NPH_Façade_Line_CurtainWallL04"; true; "NPH_Façade_Line_CurtainWallL04-2.7"; }

# group: get detail lines and draw them
getLineStyleByName = Custom[Tool.GetLineStyleByName](Ignore_Case_boolean=code_block.out1, Contains_String=code_block.out0)  # Collects LineStyle from string.contains
categories = Categories("Lines")
all_elements_of_category = ElementsOfCategory(categories)
typeName = Custom[Element.TypeName]()  # Get Type Name as string
map = List.Map(list=all_elements_of_category, f_x=typeName)
code_block_2 = CodeBlock { "Detail"; true; }
contains = String.Contains(str=map, searchFor=code_block_2.out0, ignoreCase=code_block_2.out1)
filterByBoolMask = List.FilterByBoolMask(list=all_elements_of_category, mask=contains)
code_block_3 = CodeBlock { "Line Style"; }
getParameterValueByName = Element.GetParameterValueByName(element=filterByBoolMask.in, parameterName=code_block_3)
id = Element.Id(getParameterValueByName)
element_types = ElementTypes("GraphicsStyle")
all_elements_of_type = ElementsOfType(element_types)
filterByName = Custom[Elements.FilterByName](Elements=all_elements_of_type, Search_string=code_block.out0, Ignore_case=code_block.out1)  # Retrieves those elements from a collection whose names match the search string
id_2 = Element.Id(filterByName.first)
code_block_4 = CodeBlock(a=id, b=id_2) { a==b; }
filterByBoolMask_2 = List.FilterByBoolMask(list=filterByBoolMask.in, mask=code_block_4)
geometry = Element.Geometry(filterByBoolMask_2.in)

flatten = Flatten(geometry)
length = Curve.Length(flatten)
code_block_5 = CodeBlock { 1000; }
lt = length < code_block_5
filterByBoolMask_3 = List.FilterByBoolMask(list=flatten, mask=lt)
filterByName_2 = Custom[Elements.FilterByName](Elements=all_elements_of_type, Search_string=code_block.out2, Ignore_case=code_block.out1)
id_3 = Element.Id(filterByName_2.first)
code_block_6 = CodeBlock(a=id, b=id_3) { a==b; }
filterByBoolMask_4 = List.FilterByBoolMask(list=filterByBoolMask.in, mask=code_block_6)
geometry_2 = Element.Geometry(filterByBoolMask_4.in)
flatten_2 = Flatten(geometry_2)
join = List.Join(filterByBoolMask_3.in, flatten_2)
code_block_7 = CodeBlock { 2700; 2100; }
byCoordinates = Vector.ByCoordinates(z=code_block_7.out0)

# group: draws walls from your detail lines and intersects with spaces
extrude = Curve.Extrude(curve=join, distance=byCoordinates)
code_block_8 = CodeBlock { 500; true; }

byCoordinates_2 = Vector.ByCoordinates(z=code_block_7.out1)
extrude_2 = Curve.Extrude(curve=filterByBoolMask_3.out, distance=byCoordinates_2)
join_2 = List.Join(extrude, extrude_2)
thicken = Surface.Thicken(surface=join_2, thickness=code_block_8.out0, both_sides=code_block_8.out1)
flatten_3 = Flatten(thicken)

# group: brings spaces and intersects them with the drawn wall
categories_2 = Categories("MEPSpaces")
all_elements_of_category_2 = ElementsOfCategory(categories_2)
geometry_3 = Element.Geometry(all_elements_of_category_2)
doesIntersect = Geometry.DoesIntersect(geometry=geometry_3, other=flatten_3, lacing=CrossProduct)
id_4 = Element.Id(all_elements_of_category_2)

countTrue = CountTrue(doesIntersect)
flatten_4 = Flatten()
map_2 = List.Map(list=doesIntersect, f_x=flatten_4)
code_block_9 = CodeBlock { true; }
contains_2 = Custom[List.Contains](list=map_2, item=code_block_9)  # Determines if the given list contains the item or items.
filterByBoolMask_5 = List.FilterByBoolMask(list=geometry_3, mask=contains_2)
intersect = Geometry.Intersect(geometry=filterByBoolMask_5.in, other=flatten_3, lacing=CrossProduct)
flatten_5 = Flatten()
map_3 = List.Map(list=intersect, f_x=flatten_5)
area = Solid.Area()
map_4 = List.Map(list=map_3, f_x=area)

# group: Select excel file to save data AND tab name where to save the data
file_path = Filename("\\global\europe\Dublin\Jobs\237000\237976-00\4. Internal\4-02 Drawings\4-02-20 Revit\18 Dynamo\Walls-Facades\RAW_Walls-facades-curtainwall.xlsx")
select_a_name_to_tab_from_below = CodeBlock { "WDsss"; "FN"; "FS"; "HB"; "-"; }

code_block_10 = CodeBlock { 0; false; }
filterByBoolMask_6 = List.FilterByBoolMask(list=all_elements_of_category_2, mask=contains_2)
code_block_11 = CodeBlock { "Number"; }
getParameterValueByName_2 = Element.GetParameterValueByName(element=filterByBoolMask_6.in, parameterName=code_block_11)
filterByBoolMask_7 = List.FilterByBoolMask(list=id_4, mask=contains_2)
code_block_12 = CodeBlock { "Name"; }
getParameterValueByName_3 = Element.GetParameterValueByName(element=filterByBoolMask_6.in, parameterName=code_block_12)
create = List.Create(getParameterValueByName_2, filterByBoolMask_7.in, getParameterValueByName_3)
transpose = List.Transpose(create)
explode = Geometry.Explode(map_3)
area_2 = Surface.Area()
map_5 = List.Map(list=explode, f_x=area_2)
maximumItem = List.MaximumItem()
map_6 = List.Map(list=map_5, f_x=maximumItem)
code_block_13 = CodeBlock { 1000000; }
div = map_6 / code_block_13
create_2 = List.Create(transpose, div)
transpose_2 = List.Transpose(create_2)
code_block_14 = CodeBlock { 1; }
flatten_6 = List.Flatten(list=transpose_2, amt=code_block_14)
writeToFile = Excel.WriteToFile(filePath=file_path, sheetName=select_a_name_to_tab_from_below.out0, startRow=code_block_10.out0, startCol=code_block_10.out0, data=flatten_6, overWrite=code_block_10.out1)
watch = Watch(all_elements_of_category)
watch_2 = Watch(all_elements_of_type)
name = Element.Name(all_elements_of_type)
area_3 = Solid.Area(thicken)
area_4 = Surface.Area(extrude)
code_block_15 = CodeBlock { 4959121; }
firstIndexOf = List.FirstIndexOf(list=id_4, item=code_block_15)
