# Dynamo graph Exterior_Windows_NPH-Check.dyn (Dynamo 0.8.2.2392)

categories = Categories("MEPSpaces")
all_elements_of_category = ElementsOfCategory(categories)
code_block = CodeBlock { "NPH_Space_GEN_Has_Windows"; }
file_path = Filename("\\global\europe\Dublin\Jobs\237000\237976-00\4. Internal\4-02 Drawings\4-02-20 Revit\18 Dynamo\Windows\RAW_Windows.xlsm")
code_block_2 = CodeBlock { "Yes"; "summary"; "S8"; }
read_excel = Custom[Read Excel](File_Path=file_path, RunIt=code_block_2.out0, SheetName=code_block_2.out1, ByColumn=code_block_2.out0, Origin=code_block_2.out2)  # This node will read an excel file. You can read an entore sheet contents, read from specific origin cell, read only specific range, or do all of the former for multiple sheets at the same time.
flatten = Flatten(read_excel)
code_block_3 = CodeBlock { "Yes"; "summary"; "A8"; }
read_excel_2 = Custom[Read Excel](File_Path=file_path, RunIt=code_block_3.out0, SheetName=code_block_3.out1, ByColumn=code_block_3.out0, Origin=code_block_3.out2)
flatten_2 = Flatten(read_excel_2)
code_block_4 = CodeBlock { "Number"; }
getParameterValueByName = Element.GetParameterValueByName(element=all_elements_of_category, parameterName=code_block_4)
string_from_object = FromObject(getParameterValueByName)
firstIndexOf = List.FirstIndexOf(list=flatten_2, item=string_from_object)
getItemAtIndex = List.GetItemAtIndex(list=flatten, index=firstIndexOf)
setParameterByName = Element.SetParameterByName(element=all_elements_of_category, parameterName=code_block, value=getItemAtIndex)
