# Dynamo graph Exterior_Windows_NPH-get area of window types.dyn (Dynamo 0.8.2.2392)

# group: Get window types from model
categories = Categories("Windows")
all_placed_family_types_of = Custom[All Placed Family Types of Category](Category=categories)  # Retrieves all family types of a given category that have *placed* instances
all_family_types_of_category = Custom[All Family Types Of Category](Categories=categories)  # Gets all family types/symbols of a given category in the model (does *not *work for system families)

# group: Window area
code_block = CodeBlock { "Width"; "Height"; }
getParameterValueByName = Element.GetParameterValueByName(element=all_family_types_of_category, parameterName=code_block.out0)
getParameterValueByName_2 = Element.GetParameterValueByName(element=all_family_types_of_category, parameterName=code_block.out1)
mul = getParameterValueByName * getParameterValueByName_2
code_block_2 = CodeBlock { 1000000; }
div = mul / code_block_2
create = List.Create(all_family_types_of_category, div)
transpose = List.Transpose(create)

# group: Select path to save data
file_path = Filename("C:\Users\maria.barahona\Desktop\trash\windows\RAW_Windows.xlsm")
code_block_3 = CodeBlock { "WindowTypeArea"; 1; false; }
writeToFile = Excel.WriteToFile(filePath=file_path, sheetName=code_block_3.out0, startRow=code_block_3.out1, startCol=code_block_3.out1, data=transpose, overWrite=code_block_3.out2)
