# Dynamo graph Exterior_Windows_NPH_bespoke windows areas 2.dyn (Dynamo 0.8.2.2392)

# group: get windows with Width and Height parameters
categories = Categories("Windows")
all_elements_of_category = ElementsOfCategory(categories)
code_block = CodeBlock { "Width"; "Height"; }
getParameterValueByName = Element.GetParameterValueByName(element=all_elements_of_category, parameterName=code_block.out0)
getParameterValueByName_2 = Element.GetParameterValueByName(element=all_elements_of_category, parameterName=code_block.out1)
symbol = FamilyInstance.Symbol(all_elements_of_category)
name = Element.Name(all_elements_of_category)
id = Element.Id(all_elements_of_category)

# group: which have Widh or Height parameter
code_block_2 = CodeBlock { ""; }
ne = getParameterValueByName != code_block_2
countTrue = CountTrue(ne)
ne_2 = getParameterValueByName_2 != code_block_2
countTrue_2 = CountTrue(ne_2)

file_path = Filename("\\global\europe\Dublin\Jobs\237000\237976-00\4. Internal\4-02 Drawings\4-02-20 Revit\18 Dynamo\Windows\RAW_Windows2.xlsx")
code_block_3 = CodeBlock { "BESPOKE AREAS 2"; 1; }

# group: which of those are not bespoke (already accounted for)
filterByBoolMask = List.FilterByBoolMask(list=symbol, mask=ne)
filterByBoolMask_2 = List.FilterByBoolMask(list=name, mask=ne)
code_block_4 = CodeBlock { "Bespoke"; true; }
contains = String.Contains(str=filterByBoolMask_2.in, searchFor=code_block_4.out0, ignoreCase=code_block_4.out1)
code_block_5 = CodeBlock { false; true; }
if_ = If(test=contains, true=code_block_5.out0, false=code_block_5.out1)
filterByBoolMask_3 = List.FilterByBoolMask(list=id, mask=ne)
filterByBoolMask_4 = List.FilterByBoolMask(list=getParameterValueByName, mask=ne)
filterByBoolMask_5 = List.FilterByBoolMask(list=getParameterValueByName_2, mask=ne)

name_2 = List.FilterByBoolMask(list=filterByBoolMask.in, mask=if_)
ID = List.FilterByBoolMask(list=filterByBoolMask_3.in, mask=if_)
WIDTH = List.FilterByBoolMask(list=filterByBoolMask_4.in, mask=if_)
HEIGHT = List.FilterByBoolMask(list=filterByBoolMask_5.in, mask=if_)
create = List.Create(name_2.in, ID.in, WIDTH.in, HEIGHT.in)
transpose = List.Transpose(create)
writeToFile = Excel.WriteToFile(filePath=file_path, sheetName=code_block_3.out0, startRow=code_block_3.out1, startCol=code_block_3.out1, data=transpose)
