# Dynamo graph Exterior_Windows_NPH_bespoke windows areas.dyn (Dynamo 0.8.0.950)

categories = Categories("Windows")
all_elements_of_category = ElementsOfCategory(categories)
watch = Watch(all_elements_of_category)
file_path = Filename("\\global\europe\Dublin\Jobs\237000\237976-00\4. Internal\4-02 Drawings\4-02-20 Revit\18 Dynamo\Windows\RAW_Windows.xlsm")
code_block = CodeBlock { "BespokeWindowsAreas"; 0; 1; }
string_from_object = FromObject(all_elements_of_category)
code_block_2 = CodeBlock { "BESPOKE"; true; }
contains = String.Contains(str=string_from_object, searchFor=code_block_2.out0, ignoreCase=code_block_2.out1)
filterByBoolMask = List.FilterByBoolMask(list=all_elements_of_category, mask=contains)
name = FamilySymbol.Name(filterByBoolMask.in)
id = Element.Id(all_elements_of_category)
filterByBoolMask_2 = List.FilterByBoolMask(list=id, mask=contains)
code_block_3 = CodeBlock { "Width"; "Height"; }
getParameterValueByName = Element.GetParameterValueByName(element=filterByBoolMask.in, parameterName=code_block_3.out0)
getParameterValueByName_2 = Element.GetParameterValueByName(element=filterByBoolMask.in, parameterName=code_block_3.out1)
create = List.Create(name, filterByBoolMask_2.in, getParameterValueByName, getParameterValueByName_2)
transpose = List.Transpose(create)
writeToFile = Excel.WriteToFile(file_path, code_block.out0, code_block.out2, code_block.out1, transpose)
