# Dynamo graph Exterior_Windows_from arch model_NPH.dyn (Dynamo 0.8.2.2392)

# group: Get rooms from model
categories = Categories("Rooms")
all_elements_of_category = ElementsOfCategory(categories)
geometry = Element.Geometry(all_elements_of_category)
watch = Watch(all_elements_of_category)

flatten = Flatten(geometry)

# group: Remove all rooms that are not solids
string_from_object = FromObject(flatten)
code_block = CodeBlock { "Solid"; }
firstIndexOf = List.FirstIndexOf(item=code_block)
map = List.Map(list=string_from_object, f_x=firstIndexOf)
code_block_2 = CodeBlock { 0; }
eq = map == code_block_2
filterByBoolMask = List.FilterByBoolMask(list=all_elements_of_category, mask=eq)

code_block_3 = CodeBlock { "Number"; }
getParameterValueByName = Element.GetParameterValueByName(element=filterByBoolMask.in, parameterName=code_block_3)

# group: Gets windows from Envelope Model - NPH
get_documents = Custom[Get Documents]()  # Queries all linked Revit files and retrieves their Name, LinkInstance and Document properties.
# note: Introduce number of Envelope model
code_block_4 = CodeBlock(A=get_documents.Link_Doc) { A[0]; }
categories_2 = Categories("Windows")
get_all_elements_from_linked = Custom[Get All Elements From Linked Model](LinkDoc=code_block_4, Category=categories_2)  # This node is based on code posted by Julien Benoit. Big thanks to Julien for sharing his work. This node will retrieve all elements of a given category from a given linked model.
name_of_linked_models = Watch(get_documents.Link_Name)

symbol = FamilyInstance.Symbol(get_all_elements_from_linked)
facingOrientation = FamilyInstance.FacingOrientation(get_all_elements_from_linked)

# group: get window orientation
X = Vector.X(facingOrientation)
code_block_5 = CodeBlock { 0.1; }
roundToPrecision = Custom[Math.RoundToPrecision](Number=X, Precision=code_block_5)  # Rounds a number to a specified precision
Y = Vector.Y(facingOrientation)
roundToPrecision_2 = Custom[Math.RoundToPrecision](Number=Y, Precision=code_block_5)
# note: ORIENTATION
Z = Vector.Z(facingOrientation)
roundToPrecision_3 = Custom[Math.RoundToPrecision](Number=Z, Precision=code_block_5)
facingOrientation_2 = Custom[HostedObject.FacingOrientation](element_s=get_all_elements_from_linked)  # Gets the facing orientation of a hosted object (e.g. a window or a door)

id = Element.Id(get_all_elements_from_linked)
count = Count(getParameterValueByName)
filterByBoolMask_2 = List.FilterByBoolMask(list=geometry, mask=eq)
flatten_2 = Flatten(filterByBoolMask_2.in)
geometry_2 = Element.Geometry(get_all_elements_from_linked)
byGeometryCoordinateSystem = BoundingBox.ByGeometryCoordinateSystem(geometry_2)
toPolySurface = BoundingBox.ToPolySurface(byGeometryCoordinateSystem)

# group: filter elements that do not intersect
create = List.Create(symbol, facingOrientation, roundToPrecision, roundToPrecision_2, roundToPrecision_3, id)
# note: WINDOW AREA AND ORIENTATION
# note: Create as many lists of windows as number of rooms, to make two lists of equal lenght
transpose = List.Transpose(create)
ofRepeatedItem = List.OfRepeatedItem(item=transpose, amount=count)
doesIntersect = Geometry.DoesIntersect(geometry=flatten_2, other=toPolySurface, lacing=CrossProduct)
code_block_6 = CodeBlock { false; }
replaceNulls = Lists.Manage.ReplaceNulls(doesIntersect, code_block_6)
filterByBoolMask_3 = List.FilterByBoolMask(list=ofRepeatedItem, mask=replaceNulls)

# group: remove empty lists (rooms without windows)
isEmpty = List.IsEmpty()
map_2 = List.Map(list=filterByBoolMask_3.in, f_x=isEmpty)
code_block_7 = CodeBlock { false; true; }
if_ = If(test=map_2, true=code_block_7.out0, false=code_block_7.out1)
filterByBoolMask_4 = List.FilterByBoolMask(list=filterByBoolMask_3.in, mask=if_)

# group: Rooms and numbers with windows
filterByBoolMask_5 = List.FilterByBoolMask(list=getParameterValueByName, mask=if_)
filterByBoolMask_6 = List.FilterByBoolMask(list=filterByBoolMask.in, mask=if_)

id_2 = Element.Id(filterByBoolMask_6.in)
create_2 = List.Create(filterByBoolMask_5.in, id_2)
transpose_2 = List.Transpose(create_2)
create_3 = List.Create()
map_3 = List.Map(list=transpose_2, f_x=create_3)

# group: export data to excel. Select path.
file_path = Filename("\\global\europe\Dublin\Jobs\237000\237976-00\4. Internal\4-02 Drawings\4-02-20 Revit\18 Dynamo\Windows\RAW_Windows2.xlsx")
code_block_8 = CodeBlock { "-"; "WINDOWS"; }
path = Custom[Document.Path]()  # Gets the path and directory of the current Revit document
fileName = FilePath.FileName(path.path)
code_block_9 = CodeBlock { 0; 18; }
substring = String.Substring(str=fileName, startIndex=code_block_9.out0, length=code_block_9.out1)
join = String.Join(code_block_8.out0, code_block_8.out1, substring)
code_block_10 = CodeBlock { 1; "Yes"; }
create_4 = List.Create(map_3, filterByBoolMask_4.in)
transpose_3 = List.Transpose(create_4)
code_block_11 = CodeBlock { 2; }
flatten_3 = List.Flatten(list=transpose_3, amt=code_block_11)
writeToFile = Excel.WriteToFile(filePath=file_path, sheetName=join, startRow=code_block_10.out0, startCol=code_block_10.out0, data=flatten_3, overWrite=code_block_10.out1)

code_block_12 = CodeBlock { "Room"; }
create_5 = List.Create(code_block_12)
create_6 = List.Create(create_5, transpose)
code_block_13 = CodeBlock { 1; }
flatten_4 = List.Flatten(list=create_6, amt=code_block_13)
countTrue = CountTrue(doesIntersect)
code_block_14 = CodeBlock { true; }
sublistsContain = Custom[List.SublistsContain](list=replaceNulls, item=code_block_14)  # Looks for an item in each sublist of a given list and returns true/false for each sublist.
countTrue_2 = CountTrue(sublistsContain)
number_of_rooms_with_windows = Watch(countTrue_2)
writeToFile_2 = Excel.WriteToFile(filePath=file_path, sheetName=join, startRow=code_block_10.out0, startCol=code_block_10.out0, data=flatten_3, overWrite=code_block_10.out1)
