# Dynamo graph loop.dyn (Dynamo 1.1.0.2094)

select_model_element = DSModelElementSelection()  # 1 picked in the model
code_block = CodeBlock { "Offset"; }
getParameterValueByName = Element.GetParameterValueByName(element=select_model_element, parameterName=code_block)
