# Dynamo graph select.dyn (Dynamo 1.1.0.2094)

element_types = ElementTypes("ElementType")
all_elements_of_type = ElementsOfType(element_types)
name = Family.Name(all_elements_of_type)
watch = Watch(name)
code_block = CodeBlock { "wall"; }
boolean = BoolSelector(true)
contains = String.Contains(str=name, searchFor=code_block, ignoreCase=boolean)
watch_2 = Watch(contains)
filterByBoolMask = List.FilterByBoolMask(list=all_elements_of_type, mask=watch_2)
watch_3 = Watch(filterByBoolMask.in)
name_2 = Element.Name(all_elements_of_type)
code_block_2 = CodeBlock { 3; }
getItemAtIndex = List.GetItemAtIndex(list=name_2, index=code_block_2)
filterByName = Custom[Elements.FilterByName](elements=all_elements_of_type, searchString=getItemAtIndex)  # Retrieves those elements from a collection whose names match the search string
watch_4 = Watch(filterByName.in)
watch_5 = Watch(name_2)
code_block_3 = CodeBlock { "wall"; }
code_block_4 = CodeBlock(str=name_2, search=code_block_3, igncase=boolean, list=all_elements_of_type)
# ---------- code_block_4.designscript (5 lines) ----------
mask = String.Contains(str,search,igncase);
filter = List.FilterByBoolMask(list,mask);
filter["in"][0];
filter["in"];
filter["out"];
# ----------------------------------------
watch_6 = Watch(code_block_4.out3)
name_3 = Element.Name(watch_6)
