# Dynamo graph Override Line colors.dyn (Dynamo 1.2.0.2514)

select_model_element = DSModelElementSelection()  # 1 picked in the model
class_ = Custom[Object.Class](obj=select_model_element)  # Gets the input object's class name. Can process lists.
categories = Categories("DetailComponentTags")
all_elements_of_category = ElementsOfCategory(categories)
watch = Watch(all_elements_of_category)
parameters = Element.Parameters(watch)
code_block = CodeBlock { "Workset"; }
getParameterValueByName = Element.GetParameterValueByName(element=watch, parameterName=code_block)
overrideProjectionLineweight = Custom[Element.OverrideProjectionLineweight]()  # Overrides the line thickness of projection lines; unwired: element, number
code_block_2 = CodeBlock { Flatten({list}); }  # unwired: list
code_block_3 = CodeBlock { 128; }
byARGB = Color.ByARGB(g=code_block_3)
dynamo_color_to_revit_color = Custom[Dynamo Color to Revit Color](Dynamo_Color=byARGB)
python_script = Python(IN[0]=dynamo_color_to_revit_color)
# ---------- python_script.python (28 lines) ----------
import clr
clr.AddReference('ProtoGeometry')
from Autodesk.DesignScript.Geometry import *

clr.AddReference('RevitAPI')
from Autodesk.Revit.DB import *

clr.AddReference("RevitNodes")
import Revit
clr.ImportExtensions(Revit.Elements)

clr.AddReference("RevitServices")
import RevitServices
from RevitServices.Persistence import DocumentManager
from RevitServices.Transactions import TransactionManager

doc = DocumentManager.Instance.CurrentDBDocument

trans = IN[0]

override = OverrideGraphicSettings()
#override.SetSurfaceTransparency(trans)
override.SetProjectionLineColor(trans)
#override.SetProjectionFillColor(pjfc)
#override.SetProjectionFillPatternId(pjfp)
#override.SetHalftone(ht)

OUT = override
# ----------------------------------------
code_block_4 = CodeBlock(list=python_script) { Flatten({list}); }
python_script_2 = Python(IN[1]=code_block_2, IN[2]=code_block_4)  # unwired: IN[0]
# ---------- python_script_2.python (39 lines) ----------
import clr
clr.AddReference('ProtoGeometry')
from Autodesk.DesignScript.Geometry import *

clr.AddReference('RevitAPI')
from Autodesk.Revit.DB import *

clr.AddReference("RevitNodes")
import Revit
clr.ImportExtensions(Revit.Elements)

clr.AddReference("RevitServices")
import RevitServices
from RevitServices.Persistence import DocumentManager
from RevitServices.Transactions import TransactionManager

doc = DocumentManager.Instance.CurrentDBDocument

view = UnwrapElement(IN[0])
element = IN[1]
override = IN[2]
result = []
count = 0

TransactionManager.Instance.EnsureInTransaction(doc)
while (count < len(override)):
	for i in element:
		try:
			view.SetElementOverrides(i, override[count])
			result.append("Success")
			count
			count = count + 1
		except:
			view.SetElementOverrides(i, override[count-1])
			result.append("Success")
TransactionManager.Instance.TransactionTaskDone()


OUT = result
# ----------------------------------------
code_block_5 = CodeBlock(Result=python_script_2) { Result; }
python_script_3 = Python(IN[0]=watch)
# ---------- python_script_3.python (16 lines) ----------
import clr
clr.AddReference('RevitAPI')
from Autodesk.Revit.DB import *

clr.AddReference("RevitNodes")
import Revit
clr.ImportExtensions(Revit.Elements)

items = UnwrapElement(IN[0])
elementlist = list()
for item in items:
	try:
		elementlist.append(item.Document.GetElement(item.OwnerViewId).ToDSType(True))
	except:
		elementlist.append(list())
OUT = elementlist
# ----------------------------------------
python_script_4 = Python(IN[0]=watch, IN[1]=byARGB, IN[2]=python_script_3)
# ---------- python_script_4.python (65 lines) ----------
# Created by DPSDesign, dpsdesign.org
import clr
clr.AddReference('ProtoGeometry')
from Autodesk.DesignScript.Geometry import *

# Import ToDSType(bool) extension method
clr.AddReference("RevitNodes")
import Revit
clr.ImportExtensions(Revit.Elements)

# Import DocumentManager and TransactionManager
clr.AddReference("RevitServices")
import RevitServices
from RevitServices.Persistence import DocumentManager
from RevitServices.Transactions import TransactionManager

from System.Collections.Generic import *

# Import RevitAPI
clr.AddReference("RevitAPI")
import Autodesk

doc = DocumentManager.Instance.CurrentDBDocument
uiapp = DocumentManager.Instance.CurrentUIApplication
app = uiapp.Application

#The inputs to this node will be stored as a list in the IN variable.
dataEnteringNode = IN

#unwrap all elements to use with API
elements = []
for i in IN[0]:
	elements.append(UnwrapElement(i))

views = []
for i in IN[2]:
	views.append(UnwrapElement(i))

#create graphic overrides properties
gSettings = Autodesk.Revit.DB.OverrideGraphicSettings()
#deconstruct DS Color Object and convert to RevitAPI color
dsColor = IN[1]
colRed = dsColor.Red
colGreen = dsColor.Green
colBlue = dsColor.Blue
color = Autodesk.Revit.DB.Color(colRed, colGreen, colBlue)
#set Projection Line color
gSettings.SetProjectionLineColor(color)

# "Start" the transaction
TransactionManager.Instance.EnsureInTransaction(doc)

listId = []
#apply color override to elements in an input list
for i in elements:
	listId.append(i.Id)
	id = i.Id
	for j in range(0,len(views)):
		views[j].SetElementOverrides(id, gSettings)

# "End" the transaction
TransactionManager.Instance.TransactionTaskDone()

#Assign your output to the OUT variable
OUT = listId
# ----------------------------------------
