# Dynamo graph ColourByParameterAndCreateKey_r1_v8.dyn (Dynamo 0.8.2.2392)

# group: COMMENTS
# note: Script Name: ColourByParameterAndCreateKey
# Revision: r1
# Script Usage: Overide colours in view by "Mark" parameter and create a legend
# Dynamo Version: 0.8.2.2392
# Author: Omar Kharodia
# Packages Required: -
# Clockwork
# SpringNodes

# note: Number of Random colours to generate
code_block = CodeBlock { 0..50; }
code_block_2 = CodeBlock(c=code_block) { randomColor(c); }

# group: Structural Framing
categories = Categories("StructuralFraming")
all_elements_of_category = ElementsOfCategory(categories)
code_block_3 = CodeBlock { "Mark"; }
python_script = Python(IN[0]=all_elements_of_category, IN[1]=code_block_3)
# ---------- python_script.python (58 lines) ----------
import clr
clr.AddReference('ProtoGeometry')
from Autodesk.DesignScript.Geometry import *
#The inputs to this node will be stored as a list in the IN variables.
input = IN[0]
param = IN[1]
minValue = IN[2]
maxValue = IN[3]

if isinstance(input,list) == False:
	elements = [input]
else:
	elements = input


values = []
indexes = []
mapped = []

def map(value, min, max):
	a = (value - min) / (max - min)
	return a

for e in elements:
	values.append(e.GetParameterValueByName(param))

if isinstance(values[0], str):
	uniqueValues = list(set(values))
	uniqueValues.sort()
	for v in values:
		i = 0
		for u in uniqueValues:
			if v == u:
				indexes.append(i)
				break
			i = i + 1
	min = 0.0
	max = len(uniqueValues)-1.0
	for i in indexes:
		mapped.append(map(i, min, max))

else:
	valuesSorted = []
	for v in values:
		valuesSorted.append(v)
	valuesSorted.sort()
	if minValue == 0 and maxValue == 0:
		min = valuesSorted[0]
		max = valuesSorted[len(valuesSorted) - 1]*1.0
	else:
		min = minValue
		max = maxValue
	for v in values:
		mapped.append(map(v, min, max))


#Assign your output to the OUT variable.
OUT = mapped
# ----------------------------------------
watch = Watch(python_script)

code_block_4 = CodeBlock { 10; }
mul = watch * code_block_4
ceiling = Math.Ceiling(mul)
getItemAtIndex = List.GetItemAtIndex(list=code_block_2, index=ceiling)

# group (continued): Structural Framing
watch_2 = Watch(getItemAtIndex)

overrideColorInView = Element.OverrideColorInView(element=all_elements_of_category, color=getItemAtIndex)

# group (continued): Structural Framing
output = CodeBlock(elements=overrideColorInView) { elements; }
watch_3 = Watch(output)

# group: Create Legend
select_model_element = DSModelElementSelection()
code_block_5 = CodeBlock { 0; }
uniqueItems = List.UniqueItems(watch_2)
count = List.Count(uniqueItems)
code_block_6 = CodeBlock(a=count) { 0..-7.5*a..#a; }
byCoordinates = Vector.ByCoordinates(x=code_block_5, y=code_block_6, z=code_block_5)
copy = Custom[Element.Copy](element_s=select_model_element, vector_s=byCoordinates)  # WARNING: Do not use this node in Automatic mode! Copy the input Revit elements with the help of a translation vector, similarly to the Geometry.Translate node.
code_block_7 = CodeBlock { "Comments"; }
element_name_universal = Custom[Element.Name (Universal)](element=watch_3)  # Gets an element's name (Dynamo's built-in Name nodes don't work for all element types, e.g. worksets...)
watch_4 = Watch(element_name_universal)
string_from_object = FromObject(watch_4)
uniqueItems_2 = List.UniqueItems(string_from_object)
setParameterByName = Element.SetParameterByName(element=copy, parameterName=code_block_7, value=uniqueItems_2)
watch_5 = Watch(uniqueItems_2)
watch_6 = Watch(uniqueItems)
overrideColorInView_2 = Element.OverrideColorInView(element=copy, color=uniqueItems)
watch_7 = Watch(overrideColorInView_2)

# group: Structural Columns
categories_2 = Categories("StructuralColumns")
all_elements_of_category_2 = ElementsOfCategory(categories_2)
code_block_8 = CodeBlock { "Mark"; }
python_script_2 = Python(IN[0]=all_elements_of_category_2, IN[1]=code_block_8)  # same code as python_script
watch_8 = Watch(python_script_2)
code_block_9 = CodeBlock { 255; }
code_block_10 = CodeBlock { 128; }
code_block_11 = CodeBlock { 0; }
byARGB = Color.ByARGB(r=code_block_9, g=code_block_10, b=code_block_11)
byARGB_2 = Color.ByARGB(r=code_block_10, g=code_block_9, b=code_block_10)
byARGB_3 = Color.ByARGB(r=code_block_11, g=code_block_11, b=code_block_9)
create = List.Create(byARGB, byARGB_2, byARGB_3)
code_block_12 = CodeBlock { {0,0.5,1}; }
color_range = ColorRange(create, code_block_12, python_script_2)
boolean = BoolSelector(false)
python_script_3 = Python(IN[0]=all_elements_of_category_2, IN[1]=color_range, IN[2]=boolean)
# ---------- python_script_3.python (72 lines) ----------
import clr
clr.AddReference('ProtoGeometry')
from Autodesk.DesignScript.Geometry import *

clr.AddReference("RevitNodes")
import Revit
clr.ImportExtensions(Revit.Elements)

clr.AddReference("RevitServices")
import RevitServices
from RevitServices.Persistence import DocumentManager
from RevitServices.Transactions import TransactionManager

from System.Collections.Generic import *

clr.AddReference("RevitAPI")
import Autodesk
from Autodesk.Revit.DB import *

doc = DocumentManager.Instance.CurrentDBDocument
uiapp = DocumentManager.Instance.CurrentUIApplication
app = uiapp.Application

input = IN[0]
dynColor = IN[1]
bool = IN[2]


if isinstance(input,list) == False:
	items = [input]
else:
	items = input

elements = []
for i in items:
	elements.append(UnwrapElement(i))


if bool:
	view = doc.ActiveView
	override = OverrideGraphicSettings()
	
	TransactionManager.Instance.EnsureInTransaction(doc)
	for e in elements:
		view.SetElementOverrides(e.Id, override)
	TransactionManager.Instance.TransactionTaskDone()
	OUT = elements

else:
	graphSettings = Autodesk.Revit.DB.OverrideGraphicSettings()
	color = []
	for d in dynColor:
		color.append(Autodesk.Revit.DB.Color(d.Red, d.Green, d.Blue))

	fillPat = FillPatternElement.GetFillPatternElementByName(doc, FillPatternTarget.Drafting, "Solid fill")
	
	TransactionManager.Instance.EnsureInTransaction(doc)
	
	i = 0
	for e in elements:
		id = e.Id
		#graphSettings.SetCutLineColor(color[i])
		graphSettings.SetCutFillColor(color[i])
		#graphSettings.SetProjectionLineColor(color[i])
		graphSettings.SetProjectionFillColor(color[i])
		if fillPat:
			graphSettings.SetCutFillPatternId(fillPat.Id)
			graphSettings.SetProjectionFillPatternId(fillPat.Id)
		doc.ActiveView.SetElementOverrides(id, graphSettings)
		i = i + 1
	TransactionManager.Instance.TransactionTaskDone()
	OUT = elements
# ----------------------------------------
output_2 = CodeBlock(elements=python_script_3) { elements; }
watch_9 = Watch(output_2)
watch_10 = Watch(color_range)

# group: Create Legend
element_name_universal_2 = Custom[Element.Name (Universal)](element=watch_9)
watch_11 = Watch(element_name_universal_2)
string_from_object_2 = FromObject(watch_11)
uniqueItems_3 = List.UniqueItems(string_from_object_2)
watch_12 = Watch(uniqueItems_3)
uniqueItems_4 = List.UniqueItems(watch_10)
watch_13 = Watch(uniqueItems_4)
select_model_element_2 = DSModelElementSelection()
code_block_13 = CodeBlock { 0; }
count_2 = List.Count(uniqueItems_4)
code_block_14 = CodeBlock(a=count_2) { 0..-7.5*a..#a; }
byCoordinates_2 = Vector.ByCoordinates(x=code_block_13, y=code_block_14, z=code_block_13)
copy_2 = Custom[Element.Copy](element_s=select_model_element_2, vector_s=byCoordinates_2)
code_block_15 = CodeBlock { "Comments"; }
setParameterByName_2 = Element.SetParameterByName(element=copy_2, parameterName=code_block_15, value=uniqueItems_3)
overrideColorInView_3 = Element.OverrideColorInView(element=copy_2, color=uniqueItems_4)
watch_14 = Watch(overrideColorInView_3)

code_block_16 = CodeBlock()
# ---------- code_block_16.designscript (5 lines) ----------
def rndNum(){return = Math.Random(0,255);
};

def randomColor(x){return = Color.ByARGB(255,rndNum(),rndNum(),rndNum());
};
# ----------------------------------------
