# Dynamo graph Override Color Floors.dyn (Dynamo 1.0.0.1180)

code_block = CodeBlock { 0; 255; 255; }
byARGB = Color.ByARGB(r=code_block.out0, g=code_block.out1, b=code_block.out2)
byARGB_2 = Color.ByARGB(r=code_block.out1, g=code_block.out0, b=code_block.out0)
byARGB_3 = Color.ByARGB(r=code_block.out2, g=code_block.out1, b=code_block.out0)
create = List.Create(byARGB, byARGB_2, byARGB_3)
code_block_2 = CodeBlock { 0..1; }
element_types = ElementTypes("Floor")
all_elements_of_type = ElementsOfType(element_types)
watch = Watch(all_elements_of_type)
code_block_3 = CodeBlock { "Thickness"; }
getParameterValueByName = Element.GetParameterValueByName(element=watch, parameterName=code_block_3)
remapRange = Math.RemapRange(numbers=getParameterValueByName)
color_range = ColorRange(create, code_block_2, remapRange)
watch_2 = Watch(color_range)
overrideColorInView = Element.OverrideColorInView(element=watch, color=color_range)

# group: INPUT: ELEMENTS TO COLOUR
select_model_elements = DSModelElementsSelection()  # 8 picked in the model

# group: INPUT: FILLED REGION
select_model_elements_2 = DSModelElementsSelection()

code_block_4 = CodeBlock { 0; }
uniqueItems = List.UniqueItems(color_range)
count = List.Count(uniqueItems)
code_block_5 = CodeBlock(a=count) { 0..-1500*a..#a; }
byCoordinates = Vector.ByCoordinates(x=code_block_4, y=code_block_5, z=code_block_4)
copy = Custom[Element.Copy](element_s=select_model_elements_2, vector_s=byCoordinates)  # WARNING: Do not use this node in Automatic mode! Copy the input Revit elements with the help of a translation vector, similarly to the Geometry.Translate node.
overrideColorInView_2 = Element.OverrideColorInView(element=copy, color=uniqueItems)
code_block_6 = CodeBlock { "Mark"; }
ceiling = Math.Ceiling(getParameterValueByName)
string_from_object = FromObject(ceiling)
uniqueItems_2 = List.UniqueItems(string_from_object)
code_block_7 = CodeBlock(a=uniqueItems_2) { a+"mm"; }
setParameterByName = Element.SetParameterByName(element=copy, parameterName=code_block_6, value=code_block_7)
watch_3 = Watch()
floor_types = FloorTypes()
types = Family.Types()
