# Dynamo graph Override Color Walls.dyn (Dynamo 1.2.0.2514)

code_block = CodeBlock { 0; 255; 255; }
byARGB = Color.ByARGB(r=code_block.out0, g=code_block.out1, b=code_block.out2)
byARGB_2 = Color.ByARGB(r=code_block.out1, g=code_block.out0, b=code_block.out0)
byARGB_3 = Color.ByARGB(r=code_block.out2, g=code_block.out1, b=code_block.out0)
create = List.Create(byARGB, byARGB_2, byARGB_3)
code_block_2 = CodeBlock { 0..1; }

# group: INPUT: Family
categories = Categories("Walls")

all_elements_of_category = ElementsOfCategory(categories)
wallType = Custom[Wall.WallType](wall_s=all_elements_of_category)  # Queries the wall type of the input wall. Works for types from linked documents as well.

# group: INPUT: BEAM HEIGHT PARAMETER
code_block_3 = CodeBlock { "Width"; }

getParameterValueByName = Element.GetParameterValueByName(element=wallType, parameterName=code_block_3)
remapRange = Math.RemapRange(numbers=getParameterValueByName)
color_range = ColorRange(create, code_block_2, remapRange)
watch = Watch(color_range)
overrideColorInView = Element.OverrideColorInView(element=all_elements_of_category, color=color_range)

# group: INPUT: FILLED REGION
select_model_elements = DSModelElementsSelection()

code_block_4 = CodeBlock { 0; }
uniqueItems = List.UniqueItems(color_range)
count = List.Count(uniqueItems)
code_block_5 = CodeBlock(a=count) { 0..-1500*a..#a; }
byCoordinates = Vector.ByCoordinates(x=code_block_4, y=code_block_5, z=code_block_4)
copy = Custom[Element.Copy](element=select_model_elements, vector=byCoordinates)  # WARNING: Do not use this node in Automatic mode! Copy the input Revit elements with the help of a translation vector, similarly to the Geometry.Translate node.
overrideColorInView_2 = Element.OverrideColorInView(element=copy, color=uniqueItems)
code_block_6 = CodeBlock { "Mark"; }
ceiling = Math.Ceiling(getParameterValueByName)
string_from_object = FromObject(ceiling)
uniqueItems_2 = List.UniqueItems(string_from_object)
code_block_7 = CodeBlock(a=uniqueItems_2) { a+"mm"; }
setParameterByName = Element.SetParameterByName(element=copy, parameterName=code_block_6, value=code_block_7)
watch_2 = Watch(all_elements_of_category)
randomNumbers = Lists.Sequence.RandomNumbers()  # unwired: arg0, arg1, arg2, arg3
code_block_8 = CodeBlock { 0; }
code_block_9 = CodeBlock { 255; }
random = Math.Random(code_block_8, code_block_9)
ceiling_2 = Math.Ceiling(random)
