# Dynamo graph ParameterCopy_r1_v8.dyn (Dynamo 0.8.2.2392)

# group: COMMENTS
# note: Script Name: ParameterCopy
# Revision: r1
# Script Usage: Copy a type parameter to an instance parameter
# Dynamo Version: 0.8.2.2392
# Author: Omar Kharodia
# Packages Required: -
# Bakery
# Clockwork

categories = Categories("StructuralFraming")
all_elements_of_category = ElementsOfCategory(categories)
watch = Watch(all_elements_of_category)
type = Custom[Element.Type](element=all_elements_of_category)  # Gets the family type of a given element (if applicable).
code_block = CodeBlock { "Identity_Type Mark"; }
code_block_2 = CodeBlock { "Mark"; }
set_instance_parameter_by_type = Custom[Set Instance Parameter by Type Parameter](elements=all_elements_of_category, TypeParameterNameAsString=code_block, InstanceParameterNameAsString=code_block_2)  # takes list of Elements. Works nicely with Select Model Elements input.
watch_2 = Watch(set_instance_parameter_by_type)
all_elements_of_type = ElementsOfType()
categories_2 = Categories("StructuralColumns")
all_elements_of_category_2 = ElementsOfCategory(categories_2)
watch_3 = Watch(all_elements_of_category_2)
type_2 = Custom[Element.Type](element=all_elements_of_category_2)
code_block_3 = CodeBlock { "Identity_Type Mark"; }
code_block_4 = CodeBlock { "Mark"; }
set_instance_parameter_by_type_2 = Custom[Set Instance Parameter by Type Parameter](elements=all_elements_of_category_2, TypeParameterNameAsString=code_block_3, InstanceParameterNameAsString=code_block_4)
watch_4 = Watch(set_instance_parameter_by_type_2)
all_elements_of_type_2 = ElementsOfType()
