# Dynamo graph piles v8.dyn (Dynamo 0.8.2.2392)

# group: INPUTS
select_model_element = DSModelElementSelection()  # 1 picked in the model
levels = Levels("G00 - ENTRANCE")
family_types = FamilyTypes("STR-Conc-Insitu Pile Secant-Female:1200 Dia")

curves = Element.Curves(select_model_element)
code_block = CodeBlock { 10; }
divideEqually = Curve.DivideEqually(curves, code_block)
startPoint = Curve.StartPoint(curves)
code_block_2 = CodeBlock { 900; }
divideCurveByDistance = Geometry.Curves.DivideCurveByDistance(curves, code_block_2)
endPoint = Curve.EndPoint(curves)
create = List.Create(startPoint, divideCurveByDistance, endPoint)
flatten = Flatten(create)
family_types_2 = FamilyTypes("STR-Conc-Insitu Pile Secant-Male:1200 Dia")
flatten_2 = Flatten(divideCurveByDistance)
code_block_3 = CodeBlock { 2; }
dropEveryNthItem = List.DropEveryNthItem(list=flatten_2, n=code_block_3)
byPointAndLevel = FamilyInstance.ByPointAndLevel(family_types_2, dropEveryNthItem, levels)
setParameterByName = Element.SetParameterByName(element=byPointAndLevel)
code_block_4 = CodeBlock { "Top Level"; }
levels_2 = Levels("G00 - ENTRANCE")
operations = Custom[List.Operations](List_A=flatten_2, List_B=dropEveryNthItem)  # List A-B / List Intersection / List symmetric difference
byPointAndLevel_2 = FamilyInstance.ByPointAndLevel(family_types, operations.A_B, levels)
