# Dynamo graph 03 For Nurbs.dyn (Dynamo 1.2.0.2514)

code_block = CodeBlock { 5; }
randomList = Math.RandomList(code_block)
randomList_2 = Math.RandomList(code_block)
randomList_3 = Math.RandomList(code_block)
python_script = Python(IN[0]=randomList, IN[1]=randomList_2, IN[2]=randomList_3)
# ---------- python_script.python (21 lines) ----------
import clr
clr.AddReference('ProtoGeometry')
from Autodesk.DesignScript.Geometry import *
#The inputs to this node will be stored as a list in the IN variables.

PtX = IN[0]
PtY = IN[1]
PtZ = IN[2]

Pts = []
crv = []

for x,y,z in zip(PtX,PtY,PtZ):
	Pts.append(Point.ByCoordinates(x*10,y*10,z*10))

for i in range(1,5):
	crv.append(NurbsCurve.ByControlPoints(Pts,i))
	

#Assign your output to the OUT variable.
OUT = Pts,crv
# ----------------------------------------
py_if = Python()  # unwired: IN[0]
# ---------- py_if.python (22 lines) ----------
import clr
clr.AddReference('ProtoGeometry')
from Autodesk.DesignScript.Geometry import *
#The inputs to this node will be stored as a list in the IN variables.
PtA = Point.ByCoordinates(0,0,0)
PtB = Point.ByCoordinates(5,5,0)

distance = Point.DistanceTo(PtA,PtB)

mindistance = 1

if distance < mindistance:
	ln = Line.ByStartPointEndPoint(PtA,PtB)

elif distance - mindistance < 3:
	ln = "Almost there"

else:
	ln = "Too Far Away"

#Assign your output to the OUT variable.
OUT = PtA, PtB, ln
# ----------------------------------------
python_script_2 = Python()  # unwired: IN[0]
# ---------- python_script_2.python (21 lines) ----------
import clr
clr.AddReference('ProtoGeometry')
from Autodesk.DesignScript.Geometry import *

#The inputs to this node will be stored as a list in the IN variables.

PtA = Point.ByCoordinates(0,0,0)
PtB = Point.ByCoordinates(3,3,6)
PtC = Point.ByCoordinates(4,4,2)
PtD = Point.ByCoordinates(5,8,1)
PtE = Point.ByCoordinates(9,4,5)

Pts = [PtA,PtB,PtC,PtD,PtE]
crv = []

for i in range(1,5):
	crv.append(NurbsCurve.ByControlPoints(Pts,i))

	
#Assign your output to the OUT variable.
OUT = Pts,crv
# ----------------------------------------
code_block_2 = CodeBlock(a=python_script_2) { a[1]; }
code_block_3 = CodeBlock(c=code_block_2) { rnd_col(c); }
byGeometryColor = Display.Display.ByGeometryColor(code_block_2, code_block_3, lacing=Longest)
code_block_4 = CodeBlock { def rnd1(){return = Math.Random(0,255); }; def rnd_col(x){return = Color.ByARGB(255,rnd1(),rnd1(),rnd1()); }; }
