# Dynamo graph 03 For Range.dyn (Dynamo 1.2.0.2514)

code_block = CodeBlock { x=0..10; y= 0..10; p = Point.ByCoordinates(x<1>,y<2>,0); }
code_block_2 = CodeBlock { 0..10; }
python_script = Python(IN[0]=code_block_2)
# ---------- python_script.python (39 lines) ----------
import clr
clr.AddReference('ProtoGeometry')
from Autodesk.DesignScript.Geometry import *
#The inputs to this node will be stored as a list in the IN variables.

PtA = Point.ByCoordinates(0,0,0)

PtList = IN[0]

old_cs = CoordinateSystem.Identity()

new_csx = []
for i in range(0,len(PtList)):
	new_csx.append(old_cs.Translate(i,0,0))

new_csxy = []

for item in new_csx:
	for j in range(0,len(PtList)):
		new_csxy.append(item.Translate(0,j,0))

new_PtA = []

for item in new_csxy:
	new_PtA.append(PtA.Transform(old_cs,item))

Radius = []
for item in new_PtA:
	Radius.append(Geometry.DistanceTo(Point.ByCoordinates(0,0,0),item))

new_Circles = []

for pt,rad in zip(new_PtA,Radius):
	if rad>0:
		new_Circles.append(Circle.ByCenterPointRadius(pt,rad/30))

#Assign your output to the OUT variable.

OUT = new_Circles
# ----------------------------------------
python_script_2 = Python(IN[0]=code_block_2)
# ---------- python_script_2.python (42 lines) ----------
import clr
clr.AddReference('ProtoGeometry')
from Autodesk.DesignScript.Geometry import *
#The inputs to this node will be stored as a list in the IN variables.

PtA = Point.ByCoordinates(0,0,0)

PtList = IN[0]

old_cs = CoordinateSystem.Identity()

new_csx = []
for i in range(0,len(PtList)):
	new_csx.append(old_cs.Translate(i,0,0))

new_PtA = []

for item in new_csx:
	new_PtA.append(PtA.Transform(old_cs,item))

Radius = []

for item in new_PtA:
	Radius.append(Geometry.DistanceTo(Point.ByCoordinates(0,0,0),item))


Circles = []


for pt,rad in zip(new_PtA,Radius):
	if rad>0:
		Circles.append(Circle.ByCenterPointRadius(pt,rad/32.8))

new_Circles = []

for item in Circles:
	for j in range(0,len(PtList)):
		new_Circles.append(item.Translate(0,j,0))

#Assign your output to the OUT variable.

OUT = new_Circles
# ----------------------------------------
number_slider = DoubleSlider(1.6, range=0..10 step 0.1)
python_script_3 = Python(IN[0]=code_block_2, IN[1]=number_slider)
# ---------- python_script_3.python (39 lines) ----------
import clr
clr.AddReference('ProtoGeometry')
from Autodesk.DesignScript.Geometry import *
#The inputs to this node will be stored as a list in the IN variables.

PtA = Point.ByCoordinates(IN[1],IN[1],0)

PtList = IN[0]

old_cs = CoordinateSystem.Identity()

new_csx = []
for i in range(0,len(PtList)):
	new_csx.append(old_cs.Translate(i,0,0))

new_csxy = []

for item in new_csx:
	for j in range(0,len(PtList)):
		new_csxy.append(item.Translate(0,j,0))

new_PtA = []

for item in new_csxy:
	new_PtA.append(PtA.Transform(old_cs,item))

Radius = []
for item in new_PtA:
	Radius.append(Geometry.DistanceTo(Point.ByCoordinates(0,0,0),item))

new_Circles = []

for pt,rad in zip(new_PtA,Radius):
	if rad>0:
		new_Circles.append(Circle.ByCenterPointRadius(pt,rad/30))

#Assign your output to the OUT variable.

OUT = new_Circles
# ----------------------------------------

# group: Coordinate System
py_for_vector_z = Python()  # unwired: IN[0]
# ---------- py_for_vector_z.python (18 lines) ----------
import clr
clr.AddReference('ProtoGeometry')
from Autodesk.DesignScript.Geometry import *
#The inputs to this node will be stored as a list in the IN variables.

PtA = Point.ByCoordinates(0,0,0)

new_cs = []

TransPtA = []

for i in range (0,20):
	old_cs = CoordinateSystem.Identity()
	new_cs.append(old_cs.Translate(Vector.ZAxis(),i))
	TransPtA.append(PtA.Transform(old_cs,new_cs[i]))

#Assign your output to the OUT variable.
OUT = new_cs,TransPtA
# ----------------------------------------
py_for_math = Python()  # unwired: IN[0]
# ---------- py_for_math.python (24 lines) ----------
import clr
clr.AddReference('ProtoGeometry')
from Autodesk.DesignScript.Geometry import *

import math
#The inputs to this node will be stored as a list in the IN variables.

PtA = Point.ByCoordinates(0,0,0)

new_cs = []

TransPtA = []

for i in range (0,20):
	x = math.sin(2*math.pi/10*i)
	y = math.cos(2*math.pi/10*i)
	z = i
	Vct = Vector.ByCoordinates(x,y,z)
	old_cs = CoordinateSystem.Identity()
	new_cs.append(old_cs.Translate(Vct,i))
	TransPtA.append(PtA.Transform(old_cs,new_cs[i]))

#Assign your output to the OUT variable.
OUT = TransPtA
# ----------------------------------------

py_for_math_2 = Python()  # unwired: IN[0]
# ---------- py_for_math_2.python (33 lines) ----------
import clr
clr.AddReference('ProtoGeometry')
from Autodesk.DesignScript.Geometry import *

import math
#The inputs to this node will be stored as a list in the IN variables.

PtA = Point.ByCoordinates(0,0,0)
PtB = Point.ByCoordinates(5,0,0)
PtC = Point.ByCoordinates(5,5,0)
PtD = Point.ByCoordinates(0,5,0)

Rect = Rectangle.ByCornerPoints(PtA,PtB,PtC,PtD)

hFactor = .6

Vct = []

TransRect = []

ScaleRect = []

RotRect = []

for i in range (0,20):
	Vct.append(Vector.ByCoordinates(0,0,i*hFactor))
	TransRect.append(Geometry.Translate(Rect,Vct[i]))
	sFactor = 1+abs(math.sin(math.pi*i/10))/2
	#ScaleRect.append(Geometry.Scale(TransRect[i],sFactor))
	RotRect.append(Geometry.Rotate(TransRect[i],Rectangle.Center(TransRect[i]),Vct[i],360*i/80))

	#Assign your output to the OUT variable.
OUT = RotRect,Vct
# ----------------------------------------

# group: Geometry
py_for_vector_z_2 = Python()  # unwired: IN[0]
# ---------- py_for_vector_z_2.python (14 lines) ----------
import clr
clr.AddReference('ProtoGeometry')
from Autodesk.DesignScript.Geometry import *
#The inputs to this node will be stored as a list in the IN variables.

PtA = Point.ByCoordinates(0,0,0)

TransPtA = []

for i in range (0,20):
	TransPtA.append(Geometry.Translate(PtA, Vector.ZAxis(),i))
	
#Assign your output to the OUT variable.
OUT = TransPtA
# ----------------------------------------
py_for_math_3 = Python()  # unwired: IN[0]
# ---------- py_for_math_3.python (20 lines) ----------
import clr
clr.AddReference('ProtoGeometry')
from Autodesk.DesignScript.Geometry import *

import math
#The inputs to this node will be stored as a list in the IN variables.

PtA = Point.ByCoordinates(0,0,0)

TransPtA = []

for i in range (0,20):
	x = math.sin(2*math.pi/10*i)
	y = math.cos(2*math.pi/10*i)
	z = i
	Vct = Vector.ByCoordinates(x,y,z)
	TransPtA.append(Geometry.Translate(PtA,Vct))

#Assign your output to the OUT variable.
OUT = TransPtA
# ----------------------------------------

py_for_math_4 = Python()  # unwired: IN[0]
# ---------- py_for_math_4.python (50 lines) ----------
import clr
clr.AddReference('ProtoGeometry')
from Autodesk.DesignScript.Geometry import *

import math
#The inputs to this node will be stored as a list in the IN variables.

PtA = Point.ByCoordinates(-5,-5,0)
PtB = Point.ByCoordinates(5,-5,0)
PtC = Point.ByCoordinates(5,5,0)
PtD = Point.ByCoordinates(-5,5,0)

Rect = Rectangle.ByCornerPoints(PtA,PtB,PtC,PtD)

hFactor = 1

Vct = []

TransRect = []
sFactor = []
ScaleRect = []
RotRect = []
old_cs = []
new_cs = []
Bplane = []
BplaneOr = []
RecCent = []
TransVect = []
newBPlane = []

for i in range (0,20):
	Vct.append(Vector.ByCoordinates(0,0,i*hFactor))
	
	TransRect.append(Geometry.Translate(Rect,Vct[i]))
	
	RecCent.append(Rectangle.Center(TransRect[i]))
	
	sFactor.append(1+abs(math.sin(math.pi*i/10))/3)
	
	Bplane.append(Rectangle.BasePlane(TransRect[i]))
	BplaneOr.append(Bplane[i].Origin)
	TransVect.append(Vector.ByTwoPoints(BplaneOr[i],RecCent[i]))
	newBPlane.append(Geometry.Translate(Bplane[i],TransVect[i]))
	
	ScaleRect.append(Geometry.Scale(TransRect[i],newBPlane[i],sFactor[i],sFactor[i],sFactor[i]))
	
	RotRect.append(Geometry.Rotate(ScaleRect[i],Rectangle.Center(TransRect[i]),Vct[i],360*i/80))

	#Assign your output to the OUT variable.
OUT = RotRect
# ----------------------------------------
code_block_3 = CodeBlock { Geometry.Scale(geom,plane,x,y,z); }  # unwired: geom, plane, x, y, z
code_block_4 = CodeBlock { Vector.ByTwoPoints(a,b); }  # unwired: a, b
code_block_5 = CodeBlock(vec=code_block_4) { Geometry.Translate(a,vec); }  # unwired: a
py_for_math_5 = Python()  # unwired: IN[0]
# ---------- py_for_math_5.python (40 lines) ----------
import clr
clr.AddReference('ProtoGeometry')
from Autodesk.DesignScript.Geometry import *

import math
#The inputs to this node will be stored as a list in the IN variables.

PtA = Point.ByCoordinates(-5,-5,0)
PtB = Point.ByCoordinates(5,-5,0)
PtC = Point.ByCoordinates(5,5,0)
PtD = Point.ByCoordinates(-5,5,0)

Rect = Rectangle.ByCornerPoints(PtA,PtB,PtC,PtD)

hFactor = 1

Vct = []

TransRect = []
BPlane = []
sFactor = []
ScaleRect = []
RotRect = []


for i in range (0,20):
	Vct.append(Vector.ByCoordinates(0,0,i*hFactor))
	
	TransRect.append(Geometry.Translate(Rect,Vct[i]))
	
	BPlane.append(Plane.ByOriginNormal(Rectangle.Center(TransRect[i]),Vector.ZAxis()))
	
	sFactor.append(1+abs(math.sin(math.pi*i/10))/3)
	
	ScaleRect.append(Geometry.Scale(TransRect[i],BPlane[i],sFactor[i],sFactor[i],sFactor[i]))
	
	RotRect.append(Geometry.Rotate(ScaleRect[i],Rectangle.Center(TransRect[i]),Vct[i],360*i/80))

	#Assign your output to the OUT variable.
OUT = RotRect
# ----------------------------------------
