# Dynamo graph 07 Nurbs Curve Sampling.dyn (Dynamo 1.2.0.2514)

file_path = Filename(".\TrussExampleSetup.3dm")
get_RhinoFile = Interoperability.ReadRhino.OpenRhino3dmModel.Get_RhinoFile(file_path)
get_RhinoObjects = Interoperability.ReadRhino.RhinoObject.Get_RhinoObjects(get_RhinoFile)
rhino_NurbsCurvesToDS = Interoperability.ReadRhino.RhinoTranslationToDS.Rhino_NurbsCurvesToDS(get_RhinoObjects)
roof_curve = CodeBlock(a=rhino_NurbsCurvesToDS) { a[0]; }
code_block = CodeBlock { 11; }
python_script = Python(IN[0]=roof_curve, IN[1]=code_block)
# ---------- python_script.python (20 lines) ----------
import clr
clr.AddReference('ProtoGeometry')
from Autodesk.DesignScript.Geometry import *
import math
#The inputs to this node will be stored as a list in the IN variables.

crvRoof = IN[0]

divisions = IN[1]

Pts = []


for i in range(0, int(divisions)+1):
	ran = float(i*(1.0)/int(divisions))
	Pts.append(Curve.PointAtParameter(crvRoof,ran))


#Assign your output to the OUT variable.
OUT = Pts
# ----------------------------------------
