# Dynamo graph 08 Nurbs Surface Sampling02.dyn (Dynamo 1.2.0.2514)

# note: u-division

file_path = Filename(".\08%20Nurbs%20Surface.3dm")
get_RhinoFile = Interoperability.ReadRhino.OpenRhino3dmModel.Get_RhinoFile(file_path)
get_RhinoObjects = Interoperability.ReadRhino.RhinoObject.Get_RhinoObjects(get_RhinoFile)
rhino_NurbsSurfaceToDS = Interoperability.ReadRhino.RhinoTranslationToDS.Rhino_NurbsSurfaceToDS(get_RhinoObjects)
# note: v-division
code_block = CodeBlock { 10; }
code_block_2 = CodeBlock { 10; }
# note: depth
code_block_3 = CodeBlock { 3; }
python_script = Python(IN[0]=rhino_NurbsSurfaceToDS, IN[1]=code_block, IN[2]=code_block_2, IN[3]=code_block_3)
# ---------- python_script.python (90 lines) ----------
import clr
clr.AddReference('ProtoGeometry')
from Autodesk.DesignScript.Geometry import *

#The inputs to this node will be stored as a list in the IN variables.

srf = IN[0]

udivisions = IN[1]

vdivisions = IN[2]

depth = IN[3]

topframepts = []
bottomframepts = []
allnodes = []

for i in range(0, int(udivisions)+1):
	udiv = float(i*(1.0)/int(udivisions))
	topline = []
	bottomline = []
	for j in range(0, int(vdivisions)+1):
		vdiv = float(j*(1.0)/int(vdivisions))
		pt = NurbsSurface.PointAtParameter(srf[0],udiv,vdiv)
		vct = Surface.NormalAtPoint(srf[0],pt)
		vct = Vector.Scale(vct,-depth)
		bottomPt = Geometry.Translate(pt,vct)
		topline.append(pt)
		bottomline.append(bottomPt)
	topframepts.append(topline)
	bottomframepts.append(bottomline)

beams = [] #I store here all the beams
bottomcenterpts = []

topChord = []


for i in range(0,len(topframepts)-1):

	for j in range(0,len(topframepts[i])-1):
		#top chord
		topChord.append(Line.ByStartPointEndPoint(topframepts[i][j],topframepts[i+1][j]))
		topChord.append(Line.ByStartPointEndPoint(topframepts[i][j+1],topframepts[i][j]))
		#top chord edges
		if i==len(topframepts)-2:
			topChord.append(Line.ByStartPointEndPoint(topframepts[i+1][j],topframepts[i+1][j+1]))
		if j==len(topframepts)-2:
			topChord.append(Line.ByStartPointEndPoint(topframepts[i][j+1],topframepts[i+1][j+1]))


diagonals = []

for i in range(0,len(bottomframepts)-1):
	bottomcenterrows = []
	for j in range(0,len(bottomframepts[i])-1):
		#to get center of each cell at bottom level
		tempsrf = Surface.ByPerimeterPoints([bottomframepts[i][j],bottomframepts[i+1][j],bottomframepts[i+1][j+1],bottomframepts[i][j+1]])
		center = Surface.PointAtParameter(tempsrf,0.5,0.5)
		centerpt = center
		allnodes.append(centerpt)
		bottomcenterrows.append(centerpt) 
		#diagonals
		diagonals.append(Line.ByStartPointEndPoint(topframepts[i][j],centerpt))
		diagonals.append(Line.ByStartPointEndPoint(topframepts[i+1][j],centerpt))
		diagonals.append(Line.ByStartPointEndPoint(topframepts[i+1][j+1],centerpt))
		diagonals.append(Line.ByStartPointEndPoint(topframepts[i][j+1],centerpt))
	bottomcenterpts.append(bottomcenterrows) #where I stored all the bottom chord points

bottomChord = []

#once I have stored all the bottom points I just run through them and connect them
for i in range(0,len(bottomcenterpts)-1):
    
    for j in range(0,len(bottomcenterpts[i])-1):
        
        bottomChord.append(Line.ByStartPointEndPoint(bottomcenterpts[i][j],bottomcenterpts[i+1][j]))
        bottomChord.append(Line.ByStartPointEndPoint(bottomcenterpts[i][j+1],bottomcenterpts[i][j]))
        
        if i == len(bottomcenterpts)-2:
            bottomChord.append(Line.ByStartPointEndPoint(bottomcenterpts[i+1][j],bottomcenterpts[i+1][j+1]))
        if j == len(bottomcenterpts[i])-2:
            bottomChord.append(Line.ByStartPointEndPoint(bottomcenterpts[i][j+1],bottomcenterpts[i+1][j+1]))




#Assign your output to the OUT variable.
OUT = topChord, bottomChord, diagonals
# ----------------------------------------
code_block_4 = CodeBlock(a=python_script) { a[0]; }
levels = Levels("Level 0")
structural_framing_types = StructuralFramingTypes("CHS273x10")
beamByCurve = StructuralFraming.BeamByCurve(curve=code_block_4, level=levels, structuralFramingType=structural_framing_types)
code_block_5 = CodeBlock(a=python_script) { a[1]; }
structural_framing_types_2 = StructuralFramingTypes("CHS406.4x10")
beamByCurve_2 = StructuralFraming.BeamByCurve(curve=code_block_5, level=levels, structuralFramingType=structural_framing_types_2)
code_block_6 = CodeBlock(a=python_script) { a[2]; }
structural_framing_types_3 = StructuralFramingTypes("CHS193.7x5")
beamByCurve_3 = StructuralFraming.BeamByCurve(curve=code_block_6, level=levels, structuralFramingType=structural_framing_types_3)
