# Dynamo graph 09 Recursive02.dyn (Dynamo 1.2.0.2514)

code_block = CodeBlock()
# ---------- code_block.designscript (27 lines) ----------
import clr
clr.AddReference('ProtoGeometry')
from Autodesk.DesignScript.Geometry import *
#The inputs to this node will be stored as a list in the IN variables.
crv = IN[0]
scale = IN[1]
angle = IN[2]

StPt = Curve.PointAtParameter(crv,0)
EnPt = Curve.PointAtParameter(crv,1)

vct = Vector.ByTwoPoints(EnPt,StPt)
#vct = Vector.Scale(vct,scale)

vctRotA = Vector.Rotate(vct,Vector.YAxis(),angle)
vctRotB = Vector.Rotate(vct,Vector.YAxis(),-angle)

endA = Vector.Add(vct, vctRotA)

endB = Vector.Add(vct, vctRotB)

lineA = Line.ByStartPointEndPoint(EnPt,Vector.AsPoint(endA))
lineB = Line.ByStartPointEndPoint(EnPt,Vector.AsPoint(endB))


#Assign your output to the OUT variable.
OUT = vct,lineA,lineB;
# ----------------------------------------
code_block_2 = CodeBlock { Autodesk.Point.ByCoordinates(5,5,0); }
code_block_3 = CodeBlock { Autodesk.Point.ByCoordinates(5,5,10); }
code_block_4 = CodeBlock(a=code_block_2, b=code_block_3) { Line.ByStartPointEndPoint(a,b); }
# note: Scale
code_block_5 = CodeBlock { 1.5; }
# note: Angle
code_block_6 = CodeBlock { 25; }
# note: Iteration
code_block_7 = CodeBlock { 1000; }
# note: Axis Vector
code_block_8 = CodeBlock { Vector.YAxis(); }
python_script = Python(IN[0]=code_block_4, IN[1]=code_block_5, IN[2]=code_block_6, IN[3]=code_block_7, IN[4]=code_block_8)
# ---------- python_script.python (31 lines) ----------
import clr
clr.AddReference('ProtoGeometry')
from Autodesk.DesignScript.Geometry import *

def branch(linea,scale,angle):
	StPt = Curve.PointAtParameter(linea,0)
	EnPt = Curve.PointAtParameter(linea,1)
	vct = Vector.ByTwoPoints(StPt,EnPt)
	Ln = Line.ByStartPointDirectionLength(EnPt,vct,vct.Length/scale)
	LineA = Ln.Rotate(EnPt,vect,angle)
	LineB = Ln.Rotate(EnPt,vect,-angle)
	return LineA,LineB
					
crv = IN[0]
scale = IN[1]
angle = IN[2]
count = IN[3]
vect = IN[4]

bb = []

ba = branch(crv,scale,angle)
bb.append(branch(ba[0],scale,angle))
bb.append(branch(ba[1],scale,angle))

for i in range(0,count):
	bb.append(branch(bb[i][0],scale,angle))
	bb.append(branch(bb[i][1],scale,angle))

#Assign your output to the OUT variable.
OUT = ba,bb
# ----------------------------------------
