# Dynamo graph Append item.dyn (Dynamo 1.2.1.3083)

categories = Categories("Rooms")
all_elements_of_category = ElementsOfCategory(categories)
id = Element.Id(all_elements_of_category)
code_block = CodeBlock { {"Number","Level","Area"}; }
getParameterValueByName = Element.GetParameterValueByName(element=all_elements_of_category, parameterName=code_block, lacing=CrossProduct)
transpose = List.Transpose(getParameterValueByName)
addItemToFront = List.AddItemToFront(item=code_block, list=transpose)
code_block_2 = CodeBlock { "ID"; }
python_script = Python(IN[0]=addItemToFront, IN[1]=code_block_2)
# ---------- python_script.python (12 lines) ----------
import clr
clr.AddReference('ProtoGeometry')
from Autodesk.DesignScript.Geometry import *
#The inputs to this node will be stored as a list in the IN variables.
list = IN[0]

text = IN[1]

list[0].append(text)

#Assign your output to the OUT variable.
OUT = list
# ----------------------------------------
addItemToEnd = List.AddItemToEnd(item=id, list=python_script)
code_block_3 = CodeBlock { {"Number","Level","Area","Id"}; }
getParameterValueByName_2 = Element.GetParameterValueByName(parameterName=code_block)  # unwired: element
map = List.Map(list=all_elements_of_category, f_x=getParameterValueByName_2)
addItemToEnd_2 = List.AddItemToEnd(item=id, list=map, lacing=Longest)
addItemToFront_2 = List.AddItemToFront(item=code_block_3, list=addItemToEnd_2)
transpose_2 = List.Transpose(addItemToFront_2)
