# Dynamo graph RevitApiGeometry01.dyn (Dynamo 1.3.1.1736)

# group: FILLED REGION TYPE
element_types = ElementTypes("FilledRegionType")
all_elements_of_type = ElementsOfType(element_types)
code_block = CodeBlock(a=all_elements_of_type) { {a[0]}; }
code_block_2 = CodeBlock(a=code_block) { a; }

python_script = Python(IN[2]=code_block_2)  # unwired: IN[0], IN[1]
# ---------- python_script.python (57 lines) ----------
import clr
clr.AddReference('ProtoGeometry')
from Autodesk.DesignScript.Geometry import *

# Import DocumentManager and TransactionManager
clr.AddReference("RevitServices")
import RevitServices
from RevitServices.Persistence import DocumentManager
from RevitServices.Transactions import TransactionManager

# Import RevitAPI
clr.AddReference("RevitAPI")
import Autodesk
from Autodesk.Revit.DB import *

doc = DocumentManager.Instance.CurrentDBDocument
uiapp = DocumentManager.Instance.CurrentUIApplication
app = uiapp.Application


regions = []
activeViewId = doc.ActiveView.Id;

TransactionManager.Instance.EnsureInTransaction(doc)

pts = UnwrapElement(IN[0])
innerPts = UnwrapElement(IN[1])

frt = UnwrapElement(IN[2])


profileLoops = []
outerProfileLoop = CurveLoop()
#innerProfileLoop = CurveLoop()

profileLoops.Add(outerProfileLoop)
#profileLoops.Add(innerProfileLoop)


#create filled region
for i in range(0,len(pts)-1):
	outerProfileLoop.Append(Autodesk.Revit.DB.Line.CreateBound(XYZ(pts[i].X,pts[i].Y,pts[i].Z),XYZ(pts[i+1].X,pts[i+1].Y,pts[i+1].Z)))

for j in range(0,len(innerPts)):
	innerProfileLoop = CurveLoop()
	profileLoops.Add(innerProfileLoop)
	for i in range(0,len(innerPts[j])-1):
		innerProfileLoop.Append(Autodesk.Revit.DB.Line.CreateBound(XYZ(innerPts[j][i].X,innerPts[j][i].Y,innerPts[j][i].Z),XYZ(innerPts[j][i+1].X,innerPts[j][i+1].Y,innerPts[j][i+1].Z)))


region = FilledRegion.Create(doc,frt[0].Id,activeViewId,profileLoops)
regions.Add(region)

TransactionManager.Instance.TransactionTaskDone()

#Assign your outputs to the OUT variable
OUT = regions
# ----------------------------------------
python_script_2 = Python(IN[2]=code_block_2)  # unwired: IN[0], IN[1]
# ---------- python_script_2.python (58 lines) ----------
import clr
clr.AddReference('ProtoGeometry')
from Autodesk.DesignScript.Geometry import *

# Import DocumentManager and TransactionManager
clr.AddReference("RevitServices")
import RevitServices
from RevitServices.Persistence import DocumentManager
from RevitServices.Transactions import TransactionManager

# Import RevitAPI
clr.AddReference("RevitAPI")
import Autodesk
from Autodesk.Revit.DB import *

doc = DocumentManager.Instance.CurrentDBDocument
uiapp = DocumentManager.Instance.CurrentUIApplication
app = uiapp.Application


regions = []
activeViewId = doc.ActiveView.Id;

TransactionManager.Instance.EnsureInTransaction(doc)

pts = UnwrapElement(IN[0])
innerPts = UnwrapElement(IN[1])

frt = UnwrapElement(IN[2])


profileLoops = []
outerProfileLoop = CurveLoop()
#innerProfileLoop = CurveLoop()

profileLoops.Add(outerProfileLoop)
#profileLoops.Add(innerProfileLoop)

arc = Autodesk.Revit.DB.Arc.MakeBound(0,1)
"""
#create filled region
for i in range(0,len(pts)):
	outerProfileLoop.Append(Autodesk.Revit.DB.Line.CreateBound(pts[i][0],pts[i][1]))
"""
for j in range(0,len(innerPts)):
	innerProfileLoop = CurveLoop()
	profileLoops.Add(innerProfileLoop)
	for i in range(0,len(innerPts[j])-1):
		#innerProfileLoop.Append(Autodesk.Revit.DB.Line.CreateBound(XYZ(innerPts[j][i].X,innerPts[j][i].Y,innerPts[j][i].Z),XYZ(innerPts[j][i+1].X,innerPts[j][i+1].Y,innerPts[j][i+1].Z)))
		innerProfileLoop.Append(Autodesk.Revit.DB.Line.CreateBound(innerPts[i][j]))

region = FilledRegion.Create(doc,frt[0].Id,activeViewId,profileLoops)
regions.Add(region)

TransactionManager.Instance.TransactionTaskDone()

#Assign your outputs to the OUT variable
OUT = regions
# ----------------------------------------
centerPoint = Circle.CenterPoint()  # unwired: arg0
origin = Point.Origin()
code_block_3 = CodeBlock { 2500; }
code_block_4 = CodeBlock { Autodesk.Vector.ZAxis(); }
code_block_5 = CodeBlock(ctr=origin, radius=code_block_3, vector=code_block_4) { Arc.ByCenterPointRadiusAngle(ctr,radius,0,180,vector); }
origin_2 = Point.Origin()
select_model_element = DSModelElementSelection()  # 1 picked in the model
curves = Element.Curves(select_model_element)
centerPoint_2 = Circle.CenterPoint(curves)
radius = Circle.Radius(curves)
code_block_6 = CodeBlock(ctr=centerPoint_2, radius=radius, vector=code_block_4) { Arc.ByCenterPointRadiusAngle(ctr,radius,180,360,vector); }
code_block_7 = CodeBlock { {0,0.99,1}; }
pointAtParameter = Curve.PointAtParameter(curve=code_block_6, param=code_block_7, lacing=Longest)
code_block_8 = CodeBlock { 0.00328083976474163150845660082324; }
scale = Geometry.Scale(geometry=pointAtParameter, amount=code_block_8)
select_model_elements = DSModelElementsSelection()  # 4 picked in the model
curves_2 = Element.Curves(select_model_elements)
flatten = Flatten(curves_2)
group_curves = Custom[Group Curves](Curves=flatten)  # This node will take any input of flat list of curves and group them into sublists containing "joinable" curves that is continous curves. They might form closed curves or open curves. Use PolyCurve.ByJoinedCurves to convert output groups of curves into single PolyCurves
endPoint = Curve.EndPoint(group_curves)
flatten_2 = Flatten(endPoint)
python_script_3 = Python(IN[0]=flatten_2)
# ---------- python_script_3.python (5 lines) ----------
list = IN[0]

list.append(list[0])

OUT = list
# ----------------------------------------
scale_2 = Geometry.Scale(geometry=python_script_3, amount=code_block_8)
python_script_4 = Python(IN[0]=scale, IN[2]=scale_2)  # unwired: IN[1]
# ---------- python_script_4.python (62 lines) ----------
import clr
clr.AddReference('ProtoGeometry')
from Autodesk.DesignScript.Geometry import *

# Import DocumentManager and TransactionManager
clr.AddReference("RevitServices")
import RevitServices
from RevitServices.Persistence import DocumentManager
from RevitServices.Transactions import TransactionManager

# Import RevitAPI
clr.AddReference("RevitAPI")
import Autodesk
from Autodesk.Revit.DB import *

doc = DocumentManager.Instance.CurrentDBDocument
uiapp = DocumentManager.Instance.CurrentUIApplication
app = uiapp.Application

activeViewId = doc.ActiveView.Id;
pt = UnwrapElement(IN[0])
frt = UnwrapElement(IN[1])
pts = UnwrapElement(IN[2])

ptCoord = []
regions = []

for p in pt:
	ptCoord.append(XYZ(p.X,p.Y,p.Z))

profileLoops = []



TransactionManager.Instance.EnsureInTransaction(doc)

outerProfileLoop = CurveLoop()
profileLoops.Add(outerProfileLoop)

halfCircle = CurveLoop()
profileLoops.Add(halfCircle)


#create filled region
for i in range(0,len(pts)-1):
	outerProfileLoop.Append(Autodesk.Revit.DB.Line.CreateBound(XYZ(pts[i].X,pts[i].Y,pts[i].Z),XYZ(pts[i+1].X,pts[i+1].Y,pts[i+1].Z)))


arc = Arc.Create(ptCoord[1],ptCoord[2],ptCoord[0])
#line = Line.CreateBound(ptCoord[2],ptCoord[0])
line = Line.CreateBound(arc.GetEndPoint(1),arc.GetEndPoint(0))

halfCircle.Append(arc)
halfCircle.Append(line)

region = FilledRegion.Create(doc,frt[0].Id,activeViewId,profileLoops)
regions.Add(region)

TransactionManager.Instance.TransactionTaskDone()

#Assign your outputs to the OUT variable
OUT = profileLoops
# ----------------------------------------
XY = Plane.XY()
python_script_5 = Python(IN[0]=scale, IN[1]=code_block_2, IN[2]=scale_2)
# ---------- python_script_5.python (54 lines) ----------
import clr
clr.AddReference('ProtoGeometry')
from Autodesk.DesignScript.Geometry import *

# Import DocumentManager and TransactionManager
clr.AddReference("RevitServices")
import RevitServices
from RevitServices.Persistence import DocumentManager
from RevitServices.Transactions import TransactionManager

# Import RevitAPI
clr.AddReference("RevitAPI")
import Autodesk
from Autodesk.Revit.DB import *

doc = DocumentManager.Instance.CurrentDBDocument
uiapp = DocumentManager.Instance.CurrentUIApplication
app = uiapp.Application

activeViewId = doc.ActiveView.Id;
pt = UnwrapElement(IN[0])
frt = UnwrapElement(IN[1])
pts = UnwrapElement(IN[2])

ptCoord = []
regions = []

for p in pt:
	ptCoord.append(XYZ(p.X,p.Y,p.Z))

profileLoops = []

outerProfileLoop = CurveLoop()
profileLoops.Add(outerProfileLoop)

halfCircle = CurveLoop()
profileLoops.Add(halfCircle)


#create filled region
for i in range(0,len(pts)-1):
	outerProfileLoop.Append(Autodesk.Revit.DB.Line.CreateBound(XYZ(pts[i].X,pts[i].Y,pts[i].Z),XYZ(pts[i+1].X,pts[i+1].Y,pts[i+1].Z)))


arc = Arc.Create(ptCoord[1],ptCoord[2],ptCoord[0])
#line = Line.CreateBound(ptCoord[2],ptCoord[0])
line = Line.CreateBound(arc.GetEndPoint(1),arc.GetEndPoint(0))

halfCircle.Append(arc)
halfCircle.Append(line)


#Assign your outputs to the OUT variable
OUT = profileLoops
# ----------------------------------------
python_script_6 = Python(IN[0]=code_block_2, IN[1]=python_script_5)
# ---------- python_script_6.python (37 lines) ----------
import clr
clr.AddReference('ProtoGeometry')
from Autodesk.DesignScript.Geometry import *

# Import DocumentManager and TransactionManager
clr.AddReference("RevitServices")
import RevitServices
from RevitServices.Persistence import DocumentManager
from RevitServices.Transactions import TransactionManager

# Import RevitAPI
clr.AddReference("RevitAPI")
import Autodesk
from Autodesk.Revit.DB import *

doc = DocumentManager.Instance.CurrentDBDocument
uiapp = DocumentManager.Instance.CurrentUIApplication
app = uiapp.Application

activeViewId = doc.ActiveView.Id;

frt = UnwrapElement(IN[0])
profileLoops = UnwrapElement(IN[1])

ptCoord = []
regions = []

TransactionManager.Instance.EnsureInTransaction(doc)


region = FilledRegion.Create(doc,frt[0].Id,activeViewId,profileLoops[0])
regions.Add(region)

TransactionManager.Instance.TransactionTaskDone()

#Assign your outputs to the OUT variable
OUT = profileLoops
# ----------------------------------------
python_script_7 = Python(IN[0]=scale_2, IN[1]=code_block_2)
# ---------- python_script_7.python (67 lines) ----------
import clr
clr.AddReference('ProtoGeometry')
from Autodesk.DesignScript.Geometry import *

# Import DocumentManager and TransactionManager
clr.AddReference("RevitServices")
import RevitServices
from RevitServices.Persistence import DocumentManager
from RevitServices.Transactions import TransactionManager

# Import RevitAPI
clr.AddReference("RevitAPI")
import Autodesk
from Autodesk.Revit.DB import *

doc = DocumentManager.Instance.CurrentDBDocument
uiapp = DocumentManager.Instance.CurrentUIApplication
app = uiapp.Application

activeViewId = doc.ActiveView.Id;


planePts = UnwrapElement(IN[0])
frt = UnwrapElement(IN[1])
ptCoord = []

for p in planePts:
	ptCoord.append(XYZ(p.X,p.Y,p.Z))

	
regions = []




profileLoops = []

halfCircle = CurveLoop()
profileLoops.Add(halfCircle)

TransactionManager.Instance.EnsureInTransaction(doc)

radius = 1000;
startAngle = 0
endAngle = 180

plane = Plane.CreateByThreePoints(ptCoord[0],ptCoord[1],ptCoord[2])
arc1 = Arc.Create(plane, radius, 0, 180)
#arc2 = Arc.MakeBound(arc1,0,1)
arc2 = Arc.Create(plane, radius, 180, 360)

#arc3 = Arc.Create(arc2.GetEndPoint(1),arc2.GetEndPoint(0),arc2.Evaluate(0.5,True))


halfCircle.Append(arc1)
#halfCircle.Append(arc2)

"""
halfCircle.Append(arc1)
halfCircle.Append(arc2)
region = FilledRegion.Create(doc,frt[0].Id,activeViewId,profileLoops)
regions.Add(region)
"""
TransactionManager.Instance.TransactionTaskDone()

#Assign your outputs to the OUT variable
OUT = arc1,arc2
# ----------------------------------------
code_block_9 = CodeBlock(a=python_script_7) { a[0]; }
python_script_8 = Python(IN[0]=code_block_9)
# ---------- python_script_8.python (28 lines) ----------
import clr
clr.AddReference('ProtoGeometry')
from Autodesk.DesignScript.Geometry import *

# Import DocumentManager and TransactionManager
clr.AddReference("RevitServices")
import RevitServices
from RevitServices.Persistence import DocumentManager
from RevitServices.Transactions import TransactionManager

# Import RevitAPI
clr.AddReference("RevitAPI")
import Autodesk
from Autodesk.Revit.DB import *

doc = DocumentManager.Instance.CurrentDBDocument
uiapp = DocumentManager.Instance.CurrentUIApplication
app = uiapp.Application

activeViewId = doc.ActiveView.Id;


arc = UnwrapElement(IN[0])

ea = arc.GetEndParameter(0)

#Assign your outputs to the OUT variable
OUT = ea, dir(arc)
# ----------------------------------------
select_model_element_2 = DSModelElementSelection()  # 1 picked in the model
curves_3 = Element.Curves(select_model_element_2)
curve = CurveElement.Curve(curves_3)
elementSketch = Custom[Springs.Collector.ElementSketch](element=select_model_element_2)  # Get the actual sketch lines of a sketch based element (floor, ceiling, modified wall, etc.) . You can optionally fetch the matching model curves, however this might prove comptationally heavy on larger data sets.
python_script_9 = Python(IN[0]=select_model_element_2)
# ---------- python_script_9.python (94 lines) ----------
#Copyright(c) 2016, Dimitar Venkov
# @5devene, dimitar.ven@gmail.com

import clr
import math

clr.AddReference("RevitServices")
import RevitServices
from RevitServices.Persistence import DocumentManager
from RevitServices.Transactions import TransactionManager
doc = DocumentManager.Instance.CurrentDBDocument

clr.AddReference("RevitNodes")
import Revit
clr.ImportExtensions(Revit.Elements)
clr.ImportExtensions(Revit.GeometryConversion)

clr.AddReference("RevitAPI")
from Autodesk.Revit.DB import *

def tolist(obj1):
	if hasattr(obj1,"__iter__"): return obj1
	else: return [obj1]

def output1(l1):
	if len(l1) == 1: return l1[0]
	else: return l1

elements = UnwrapElement(tolist(IN[0]))
getModel = IN[1]

accepted_mc = "Autodesk.Revit.DB.ModelLine, Autodesk.Revit.DB.ModelArc, Autodesk.Revit.DB.ModelEllipse, Autodesk.Revit.DB.ModelHermiteSpline, Autodesk.Revit.DB.ModelNurbSpline"

def almost_eq(line, mc):
	line2 = mc.Location.Curve
	xyz1 = line.Evaluate(0.5, True)
	if not line2.IsBound:
		xyz2 = line2.Center
		try: xyz1 = line.Center
		except: pass
	else:
		xyz2 = line2.Evaluate(0.5, True)
	if xyz1.DistanceTo(xyz2) <= 0.0001:
		return True
	else:
		return False

def clean1(l1):
	for i in xrange(len(l1) ):
		l1[i] = [x for x in l1[i] if x != None]
	return l1

def getSketch(el1):
	try:
		sk1 = doc.GetElement(ElementId(el1.Id.IntegerValue - 1) )
	except:
		sk1 = None
	if not getModel and sk1 is not None and sk1.GetType().ToString() == 'Autodesk.Revit.DB.Sketch':
		profile = sk1.Profile
	else:
		t1 = SubTransaction(doc)
		t1.Start()
		deleted = doc.Delete(el1.Id)
		t1.RollBack()
		
		profile, mc = CurveArrArray(), []
		for d in deleted:
			test_el = doc.GetElement(d)
			el_type = test_el.GetType().ToString()
			if el_type == "Autodesk.Revit.DB.Sketch":
				profile = test_el.Profile
				if not getModel:
					break
			elif getModel and el_type in accepted_mc :
				mc.append(test_el)

	ordered_mc = [ [None] * i.Size for i in profile] if getModel else []
	curves = [ [None] * i.Size for i in profile]
	for i in xrange(profile.Size):
		for j in xrange(profile[i].Size):
			curves[i][j] = profile[i][j].ToProtoType()
			if getModel:
				for k in xrange(len(mc)):
					if almost_eq(profile[i][j], mc[k]):
						ordered_mc[i][j] = mc[k].ToDSType(True)
						del mc[k]
						break
						
	return curves, clean1(ordered_mc)

TransactionManager.Instance.EnsureInTransaction(doc)
result = map(getSketch, elements)
TransactionManager.Instance.TransactionTaskDone()
OUT = output1([r[0] for r in result]), output1([r[1] for r in result])
# ----------------------------------------
