# Dynamo graph classExample.dyn (Dynamo 1.3.2.2480)

python_script = Python()  # unwired: IN[0]
# ---------- python_script.python (21 lines) ----------
import clr
clr.AddReference('ProtoGeometry')
from Autodesk.DesignScript.Geometry import *
#The inputs to this node will be stored as a list in the IN variables.
class RectDuct():
	def __init__(self):
		self.Shape = None
		self.Name = None
		pass

list= []

for i in range(0,3):
	instance = RectDuct()
	instance.Shape = "square"
	instance.Name = "Duct"+i.ToString()
	list.append(instance)


#Assign your output to the OUT variable.
OUT = list
# ----------------------------------------
python_script_2 = Python(IN[0]=python_script)
# ---------- python_script_2.python (12 lines) ----------
import clr
clr.AddReference('ProtoGeometry')
from Autodesk.DesignScript.Geometry import *
#The inputs to this node will be stored as a list in the IN variables.

list = []

for l in IN[0]:
	subout = l.Shape
	list.append(subout)
	
OUT = list
# ----------------------------------------
