# Dynamo graph dictionary.dyn (Dynamo 1.3.1.1736)

code_block = CodeBlock { {"A","B","C","D"}; }
code_block_2 = CodeBlock { {1,2,3,4,5}; }
createDictionary = Lists.Dictionary.CreateDictionary(code_block, code_block_2)
code_block_3 = CodeBlock { {"C","B","C"}; }
getValueFromDictionary = Lists.Dictionary.GetValueFromDictionary(createDictionary, code_block_3)
