# Dynamo graph 01 Points Lines Vectors.dyn (Dynamo 1.2.0.2514)

# group: Coordinate System
py_translate = Python()  # unwired: IN[0]
# ---------- py_translate.python (17 lines) ----------
import clr
clr.AddReference('ProtoGeometry')
from Autodesk.DesignScript.Geometry import *
#The inputs to this node will be stored as a list in the IN variables.
PtA = Point.ByCoordinates(0,0,0)
PtB = Point.ByCoordinates(5,5,0)

LnAB = Line.ByStartPointEndPoint(PtA,PtB)

old_cs = CoordinateSystem.Identity()

Trans_cs = old_cs.Translate(Vector.XAxis(),5)

TransLnAB = LnAB.Transform(old_cs,Trans_cs)

#Assign your output to the OUT variable.
OUT = old_cs,LnAB,Trans_cs,TransLnAB
# ----------------------------------------
py_rotate = Python()  # unwired: IN[0]
# ---------- py_rotate.python (17 lines) ----------
import clr
clr.AddReference('ProtoGeometry')
from Autodesk.DesignScript.Geometry import *
#The inputs to this node will be stored as a list in the IN variables.
PtA = Point.ByCoordinates(0,0,0)
PtB = Point.ByCoordinates(5,5,0)

LnAB = Line.ByStartPointEndPoint(PtA,PtB)

old_cs = CoordinateSystem.Identity()

Rot_cs = old_cs.Rotate(PtA,Vector.ZAxis(),45)

RotLnAB = LnAB.Transform(old_cs,Rot_cs)

#Assign your output to the OUT variable.
OUT = LnAB,Rot_cs,RotLnAB
# ----------------------------------------

py_translate_2 = Python()  # unwired: IN[0]
# ---------- py_translate_2.python (15 lines) ----------
import clr
clr.AddReference('ProtoGeometry')
from Autodesk.DesignScript.Geometry import *
#The inputs to this node will be stored as a list in the IN variables.
PtA = Point.ByCoordinates(0,0,0)
PtB = Point.ByCoordinates(5,5,0)

LnAB = Line.ByStartPointEndPoint(PtA,PtB)

Vct = Vector.XAxis()

TransLn = Geometry.Translate(LnAB, Vct,5)

#Assign your output to the OUT variable.
OUT = LnAB,TransLn
# ----------------------------------------
py_rotate_2 = Python()  # unwired: IN[0]
# ---------- py_rotate_2.python (15 lines) ----------
import clr
clr.AddReference('ProtoGeometry')
from Autodesk.DesignScript.Geometry import *
#The inputs to this node will be stored as a list in the IN variables.
PtA = Point.ByCoordinates(0,0,0)
PtB = Point.ByCoordinates(5,5,0)

LnAB = Line.ByStartPointEndPoint(PtA,PtB)

Vct = Vector.ZAxis()

RotLn = Geometry.Rotate(LnAB, PtA, Vct, 45)

#Assign your output to the OUT variable.
OUT = LnAB,RotLn
# ----------------------------------------
py_translate_3 = Python()  # unwired: IN[0]
# ---------- py_translate_3.python (15 lines) ----------
import clr
clr.AddReference('ProtoGeometry')
from Autodesk.DesignScript.Geometry import *
#The inputs to this node will be stored as a list in the IN variables.
PtA = Point.ByCoordinates(0,0,0)
PtB = Point.ByCoordinates(5,5,0)

LnAB = Line.ByStartPointEndPoint(PtA,PtB)

Vct = Vector.XAxis()

TransLn = LnAB.Translate(Vct,5)

#Assign your output to the OUT variable.
OUT = LnAB,TransLn
# ----------------------------------------
py_rotate_3 = Python()  # unwired: IN[0]
# ---------- py_rotate_3.python (15 lines) ----------
import clr
clr.AddReference('ProtoGeometry')
from Autodesk.DesignScript.Geometry import *
#The inputs to this node will be stored as a list in the IN variables.
PtA = Point.ByCoordinates(0,0,0)
PtB = Point.ByCoordinates(5,5,0)

LnAB = Line.ByStartPointEndPoint(PtA,PtB)

Vct = Vector.ZAxis()

RotLn = LnAB.Rotate(PtA, Vct, 45)

#Assign your output to the OUT variable.
OUT = LnAB,RotLn
# ----------------------------------------
