# Dynamo graph 02 If.dyn (Dynamo 1.2.0.2514)

code_block = CodeBlock { 40; }
randomList = Math.RandomList(code_block)
randomList_2 = Math.RandomList(code_block)
randomList_3 = Math.RandomList(code_block)
python_script = Python(IN[0]=randomList, IN[1]=randomList_2, IN[2]=randomList_3)
# ---------- python_script.python (17 lines) ----------
import clr
clr.AddReference('ProtoGeometry')
from Autodesk.DesignScript.Geometry import *
#The inputs to this node will be stored as a list in the IN variables.

PtX = IN[0]
PtY = IN[1]
PtZ = IN[2]

Pts = []

for x,y,z in zip(PtX,PtY,PtZ):
	Pts.append(Point.ByCoordinates(x*10,y*10,z*10))
	

#Assign your output to the OUT variable.
OUT = Pts
# ----------------------------------------
py_if = Python()  # unwired: IN[0]
# ---------- py_if.python (22 lines) ----------
import clr
clr.AddReference('ProtoGeometry')
from Autodesk.DesignScript.Geometry import *
#The inputs to this node will be stored as a list in the IN variables.
PtA = Point.ByCoordinates(0,0,0)
PtB = Point.ByCoordinates(5,5,0)

distance = Point.DistanceTo(PtA,PtB)

mindistance = 1

if distance < mindistance:
	ln = Line.ByStartPointEndPoint(PtA,PtB)

elif distance - mindistance < 3:
	ln = "Almost there"

else:
	ln = "Too Far Away"

#Assign your output to the OUT variable.
OUT = PtA, PtB, ln
# ----------------------------------------
