# Dynamo graph 04 For Range Twist.dyn (Dynamo 1.2.0.2514)

py_for_math = Python()  # unwired: IN[0]
# ---------- py_for_math.python (50 lines) ----------
import clr
clr.AddReference('ProtoGeometry')
from Autodesk.DesignScript.Geometry import *

import math
#The inputs to this node will be stored as a list in the IN variables.

PtA = Point.ByCoordinates(-5,-5,0)
PtB = Point.ByCoordinates(5,-5,0)
PtC = Point.ByCoordinates(5,5,0)
PtD = Point.ByCoordinates(-5,5,0)

Rect = Rectangle.ByCornerPoints(PtA,PtB,PtC,PtD)

hFactor = 1

Vct = []

TransRect = []
sFactor = []
ScaleRect = []
RotRect = []
old_cs = []
new_cs = []
Bplane = []
BplaneOr = []
RecCent = []
TransVect = []
newBPlane = []

for i in range (0,20):
	Vct.append(Vector.ByCoordinates(0,0,i*hFactor))
	
	TransRect.append(Geometry.Translate(Rect,Vct[i]))
	
	RecCent.append(Rectangle.Center(TransRect[i]))
	
	sFactor.append(1+abs(math.sin(math.pi*i/10))/3)
	
	Bplane.append(Rectangle.BasePlane(TransRect[i]))
	BplaneOr.append(Bplane[i].Origin)
	TransVect.append(Vector.ByTwoPoints(BplaneOr[i],RecCent[i]))
	newBPlane.append(Geometry.Translate(Bplane[i],TransVect[i]))
	
	ScaleRect.append(Geometry.Scale(TransRect[i],newBPlane[i],sFactor[i],sFactor[i],sFactor[i]))
	
	RotRect.append(Geometry.Rotate(ScaleRect[i],Rectangle.Center(TransRect[i]),Vct[i],360*i/80))

	#Assign your output to the OUT variable.
OUT = RotRect
# ----------------------------------------
py_for_math_2 = Python()  # unwired: IN[0]
# ---------- py_for_math_2.python (39 lines) ----------
import clr
clr.AddReference('ProtoGeometry')
from Autodesk.DesignScript.Geometry import *

import math
#The inputs to this node will be stored as a list in the IN variables.

PtA = Point.ByCoordinates(-5,-5,0)
PtB = Point.ByCoordinates(5,-5,0)
PtC = Point.ByCoordinates(5,5,0)
PtD = Point.ByCoordinates(-5,5,0)

Rect = Rectangle.ByCornerPoints(PtA,PtB,PtC,PtD)

hFactor = 4

Vct = []
TransRect = []
BPlane = []
scaleFactor = []
ScaleRect = []
RotRect = []


for i in range (0,20):
	Vct.append(Vector.ByCoordinates(0,0,i*hFactor))
	
	TransRect.append(Geometry.Translate(Rect,Vct[i]))
	
	BPlane.append(Plane.ByOriginNormal(Rectangle.Center(TransRect[i]),Vector.ZAxis()))
	
	scaleFactor.append(1+abs(math.sin(math.pi*i/10))/3)
	
	ScaleRect.append(Geometry.Scale(TransRect[i],BPlane[i],scaleFactor[i],scaleFactor[i],scaleFactor[i]))
	
	RotRect.append(Geometry.Rotate(ScaleRect[i],Rectangle.Center(TransRect[i]),Vct[i],360*i/80))

#Assign your output to the OUT variable.
OUT = RotRect
# ----------------------------------------
