# Dynamo graph 05 Lists.dyn (Dynamo 1.2.0.2514)

python_script = Python()  # unwired: IN[0]
# ---------- python_script.python (24 lines) ----------
import clr
clr.AddReference('ProtoGeometry')
from Autodesk.DesignScript.Geometry import *
import math

#The inputs to this node will be stored as a list in the IN variables.
PtA = Point.ByCoordinates(0,0,5)

Vct = []
listPts = []

for i in range (0,50):
	x = math.sin(2*math.pi/10*i)*i/5
	y = math.cos(2*math.pi/10*i)*i/5
	z = -i/10
	
	Vct.append(Vector.ByCoordinates(x,y,z))
	
	listPts.append(Geometry.Translate(PtA, Vct[i]))
	
crv = NurbsCurve.ByControlPoints(listPts,2)

#Assign your output to the OUT variable.
OUT = listPts, crv
# ----------------------------------------
