# Dynamo graph 06 Exercise A Truss.dyn (Dynamo 1.2.0.2514)

file_path = Filename(".\TrussExampleSetup.3dm")
get_RhinoFile = Interoperability.ReadRhino.OpenRhino3dmModel.Get_RhinoFile(file_path)
get_RhinoObjects = Interoperability.ReadRhino.RhinoObject.Get_RhinoObjects(get_RhinoFile)
rhino_NurbsCurvesToDS = Interoperability.ReadRhino.RhinoTranslationToDS.Rhino_NurbsCurvesToDS(get_RhinoObjects)
code_block = CodeBlock(a=rhino_NurbsCurvesToDS) { a[0]; }
code_block_2 = CodeBlock(a=rhino_NurbsCurvesToDS) { a[1]; }
subdivision_length = CodeBlock { 10; }
minimum_height = CodeBlock { 3; }
python_script = Python(IN[0]=code_block, IN[1]=code_block_2, IN[2]=subdivision_length, IN[3]=minimum_height)
# ---------- python_script.python (71 lines) ----------
import clr
clr.AddReference('ProtoGeometry')
from Autodesk.DesignScript.Geometry import *
import math
#The inputs to this node will be stored as a list in the IN variables.

crvRoof = IN[0]

crvFloor = IN[1]

subdiv = IN[2]

minHH = IN[3]

crvLen = crvRoof.Length #Length of the Roof

divisions = math.ceil(crvLen/subdiv)

newSubDiv = crvLen/divisions

#ptsTop = Curve.PointAtParameter(crvRoof,div)

ptsTop = NurbsCurve.PointsAtEqualSegmentLength(crvRoof,divisions) #top chord nodes

ptsBottom = [] #bottom chord nodes

error = "False" #define a check variable

param = []


dist = []

for i in range(0,len(ptsTop)): #for each node of top chord
	#distance to ground found with the closest point
	param.append(NurbsCurve.ClosestPointTo(crvFloor,ptsTop[i]))
	distance = (Geometry.DistanceTo(ptsTop[i],param[i]))
	dist.append(distance)

	if distance < minHH:
		#if the profile is too close to the terrain
		distance = "Profile too close"
		error = "True" 
		break
	
	if distance - minHH < newSubDiv:
		#if the truss is closer than the field length
		trussHeight = distance - minHH
	else:
		trussHeight = newSubDiv
	#bottom chord points
	newpt = Point.ByCoordinates(ptsTop[i].X,ptsTop[i].Y,ptsTop[i].Z-trussHeight)
	#append newpt to the list
	ptsBottom.append(newpt)	

topChord = []
botChord = []
verticals = []
diagonals = []
invertdiagonals = []
#GENERATE TRUSS GEOMETRY
if error == "False":
	topChord.append(PolyCurve.ByPoints(ptsTop))
	botChord.append(PolyCurve.ByPoints(ptsBottom))
	for i in range(0,len(ptsTop)):
	   	verticals.append(Line.ByStartPointEndPoint(ptsTop[i],ptsBottom[i]))
	   	if i < len(ptsTop)-1:
	   		diagonals.append(Line.ByStartPointEndPoint(ptsTop[i],ptsBottom[i+1]))
			invertdiagonals.append(Line.ByStartPointEndPoint(ptsBottom[i],ptsTop[i+1]))
#Assign your output to the OUT variable.
OUT = topChord,botChord,verticals,diagonals,invertdiagonals
# ----------------------------------------
code_block_3 = CodeBlock { NurbsCurve.DivideByLengthFromParameter(a,b,0); }  # unwired: a, b
code_block_4 = CodeBlock(b=subdivision_length) { Autodesk.Curve.DivideEqually(a,b); }  # unwired: a
code_block_5 = CodeBlock { crv.PointAtParameter(0..1..#11); }  # unwired: crv
code_block_6 = CodeBlock { 0.5; }
code_block_7 = CodeBlock(crv=code_block, b=code_block_6) { Autodesk.Curve.PointAtParameter(crv,b); }
code_block_8 = CodeBlock { (0..1..#11); }
python_script_2 = Python(IN[0]=code_block, IN[1]=subdivision_length)
# ---------- python_script_2.python (25 lines) ----------
import clr
clr.AddReference('ProtoGeometry')
from Autodesk.DesignScript.Geometry import *
import math
#The inputs to this node will be stored as a list in the IN variables.
dataEnteringNode = IN

crvRoof = IN[0]

subdiv = IN[1]

crvLen = crvRoof.Length #Length of the Roof

divisions = math.ceil(crvLen/subdiv)

newSubDiv = crvLen/divisions


ran = []
for i in range(0, int(divisions)):
	ran.append(float((i+1.0)/int(divisions)))


#Assign your output to the OUT variable.
OUT = divisions,ran,float(5.0/4)
# ----------------------------------------
code_block_9 = CodeBlock { 0..1..#4; }
