# Dynamo graph 06 Exercise A Truss01.dyn (Dynamo 1.2.0.2514)

file_path = Filename(".\TrussExampleSetup.3dm")
get_RhinoFile = Interoperability.ReadRhino.OpenRhino3dmModel.Get_RhinoFile(file_path)
get_RhinoObjects = Interoperability.ReadRhino.RhinoObject.Get_RhinoObjects(get_RhinoFile)
rhino_NurbsCurvesToDS = Interoperability.ReadRhino.RhinoTranslationToDS.Rhino_NurbsCurvesToDS(get_RhinoObjects)
roof_curve = CodeBlock(a=rhino_NurbsCurvesToDS) { a[0]; }
terrain_curve = CodeBlock(a=rhino_NurbsCurvesToDS) { a[1]; }
subdivision_length = CodeBlock { 7; }
minimum_height = CodeBlock { 3; }
python_script = Python(IN[0]=roof_curve, IN[1]=terrain_curve, IN[2]=subdivision_length, IN[3]=minimum_height)
# ---------- python_script.python (75 lines) ----------
import clr
clr.AddReference('ProtoGeometry')
from Autodesk.DesignScript.Geometry import *
import math
#The inputs to this node will be stored as a list in the IN variables.

crvRoof = IN[0]

crvFloor = IN[1]

subdiv = IN[2]

minHH = IN[3]

#DEFINING THE TRUSS NODES

crvLen = crvRoof.Length #Length of the Roof Curve

divisions = math.ceil(crvLen/subdiv)

newSubDiv = crvLen/divisions

ptsTop = []


for i in range(0, int(divisions)+1):
	ran = float(i*(1.0)/int(divisions))
	ptsTop.append(Curve.PointAtParameter(crvRoof,ran))


ptsBottom = [] #bottom chord nodes

error = "False" #define a check variable

for i in range(0,len(ptsTop)): #for each node of top chord
	#distance to ground found with the closest point
	param = (NurbsCurve.ClosestPointTo(crvFloor,ptsTop[i]))
	distance = (Geometry.DistanceTo(ptsTop[i],param))
	
	if distance < minHH:
		#if the profile is too close to the terrain
		distance = "Profile too close"
		error = "True" 
		break
	
	if distance - minHH < newSubDiv:
		#if the truss is closer than the field length
		trussHeight = distance - minHH
	else:
		trussHeight = newSubDiv
	#bottom chord points
	newpt = Point.ByCoordinates(ptsTop[i].X,ptsTop[i].Y,ptsTop[i].Z-trussHeight)
	#append newpt to the list
	ptsBottom.append(newpt)	

topChord = []
botChord = []
verticals = []
diagonals = []
invertdiagonals = []

#GENERATE TRUSS GEOMETRY
if error == "False":
	topChord.append(PolyCurve.ByPoints(ptsTop))
	botChord.append(PolyCurve.ByPoints(ptsBottom))
	
	for i in range(0,len(ptsTop)):
	   	verticals.append(Line.ByStartPointEndPoint(ptsTop[i],ptsBottom[i]))
	   	
	   	if i < len(ptsTop)-1:
	   		diagonals.append(Line.ByStartPointEndPoint(ptsTop[i],ptsBottom[i+1]))
			invertdiagonals.append(Line.ByStartPointEndPoint(ptsBottom[i],ptsTop[i+1]))
			
#Assign your output to the OUT variable.
OUT = distance,crvLen,divisions,topChord,botChord,verticals,diagonals,invertdiagonals,ptsBottom
# ----------------------------------------
