# Dynamo graph 09 Recursive.dyn (Dynamo 1.2.0.2514)

code_block = CodeBlock { Autodesk.Point.ByCoordinates(0,0,0); }
code_block_2 = CodeBlock { Autodesk.Point.ByCoordinates(0,0,10); }
code_block_3 = CodeBlock(a=code_block, b=code_block_2) { Line.ByStartPointEndPoint(a,b); }
code_block_4 = CodeBlock { Vector.ZAxis; }
code_block_5 = CodeBlock { 30; }
code_block_6 = CodeBlock { 1.5; }
code_block_7 = CodeBlock { 9; }
python_script = Python(IN[0]=code_block_3, IN[1]=code_block_4, IN[2]=code_block_5, IN[3]=code_block_6, IN[4]=code_block_7)
# ---------- python_script.python (40 lines) ----------
import clr
clr.AddReference('ProtoGeometry')
from Autodesk.DesignScript.Geometry import *
#The inputs to this node will be stored as a list in the IN variables.

line = IN[0]
axis = IN[1]
angle = IN[2]
scale = IN[3]
n = IN[4]

"""

def branch(line,angle,scale,axis,n):
	if n>0:
		start = Curve.PointAtParameter(line,0)
		end = Curve.PointAtParameter(line,1)
		
		vect = Vector.ByTwoPoints(end,start)
		vect = Vector.Scale(vect,scale)
		
		vectRotA = Vector.Rotate(vect,angle,axis)
		vectRotB = Vector.Rotate(vect,-angle,axis)
		
		endA = Vector.Add(end,vectRotA)
		endB = Vector.Add(end,vectRotB)
		
		lineA = Line.ByStartPointEndPoint(end,endA)
		lineB = Line.ByStartPointEndPoint(end,endB)
		
		branch(lineA,angle,scale,axis,n-1))
		branch(lineB,angle,scale,axis,n-1))
	

brancho = branch(lineA,angle,scale,axis,n-1))
"""
crv = Curve.PointAtParameter(line,0)

#Assign your output to the OUT variable.
OUT = crv
# ----------------------------------------
python_script_2 = Python(IN[0]=code_block_3)
# ---------- python_script_2.python (11 lines) ----------
import clr
clr.AddReference('ProtoGeometry')
from Autodesk.DesignScript.Geometry import *
#The inputs to this node will be stored as a list in the IN variables.
crv = IN[0]

pt = Curve.PointAtParameter(crv,0)


#Assign your output to the OUT variable.
OUT = pt
# ----------------------------------------
