# Dynamo graph Geometry.dyn (Dynamo 1.2.0.2514)

file_path = Filename("C:\Users\giovanni.brogioli\Desktop\presentation\roof.sat")
fromPath = FileObject(file_path)  # "File.FromPath"
importFromSAT = Geometry.ImportFromSAT(fromPath)
code_block = CodeBlock(a=importFromSAT) { Solid.Explode(a); }
code_block_2 = CodeBlock(a=code_block) { Surface.PerimeterCurves(a[0]); }
code_block_3 = CodeBlock { 10; }
code_block_4 = CodeBlock(crv=code_block_2, divisions=code_block_3) { Curve.DivideByDistance(crv,divisions); }
code_block_5 = CodeBlock(a=code_block_4) { Line.PointAtParameter(a[0],0); }
code_block_6 = CodeBlock(a=code_block_4) { Line.PointAtParameter(a[2],1); }
code_block_7 = CodeBlock(a=code_block_6) { List.Reverse(a); }
code_block_8 = CodeBlock(a=code_block_5, b=code_block_7) { Line.ByStartPointEndPoint(a,b); }
code_block_9 = CodeBlock(a=code_block_4) { PolyCurve.ByJoinedCurves(a); }
length = Curve.Length(code_block_9)
code_block_10 = CodeBlock(a=code_block_4) { Line.PointAtParameter(a[1],0); }
code_block_11 = CodeBlock(a=code_block_4) { Line.PointAtParameter(a[3],1); }
code_block_12 = CodeBlock(a=code_block_11) { List.Reverse(a); }
code_block_13 = CodeBlock(a=code_block_10, b=code_block_12) { Line.ByStartPointEndPoint(a,b); }
