# Dynamo graph Home.dyn (Dynamo 1.2.0.2514)

python_script = Python()  # unwired: IN[0]
# ---------- python_script.python (34 lines) ----------
import clr
clr.AddReference('ProtoGeometry')
from Autodesk.DesignScript.Geometry import *

clr.AddReference('RevitAPI') 
clr.AddReference('RevitAPIUI') 
from Autodesk.Revit.DB import * 

# Import DocumentManager
clr.AddReference('RevitServices')
import RevitServices
from RevitServices.Persistence import DocumentManager


doc = DocumentManager.Instance.CurrentDBDocument
uiapp = DocumentManager.Instance.CurrentUIApplication
app = uiapp.Application

#The inputs to this node will be stored as a list in the IN variables.

collector = FilteredElementCollector(doc)
stairs = collector.OfCategory(BuiltInCategory.OST_Stairs)
stairslist = list(stairs)

stairsName = []

for i in stairslist:
	stairsName.append(i.GetType().Name)

#for i in views:
#	viewsName.append(i.Name)

#Assign your output to the OUT variable.
OUT = stairs,stairslist,stairsName
# ----------------------------------------
watch = Watch(python_script)
code_block = CodeBlock { 1; }
getItemAtIndex = List.GetItemAtIndex(list=watch, index=code_block)
name = Element.Name(getItemAtIndex)
code_block_2 = CodeBlock { 0; }
code_block_3 = CodeBlock { 2; }
all_categories_names = Python()  # unwired: IN[0]
# ---------- all_categories_names.python (27 lines) ----------
import clr

# Import DocumentManager and TransactionManager
clr.AddReference("RevitServices")
import RevitServices
from RevitServices.Persistence import DocumentManager

# Import RevitAPI
clr.AddReference("RevitAPI")
import Autodesk
from Autodesk.Revit.DB import *

documentSettings = DocumentManager.Instance.CurrentDBDocument

group = documentSettings.Settings.Categories

groupName = []

for i in group:
	groupName.append(i.Name)

#OUT = "Number of all categories in current Revit document:" + str(group.Size)

floorCategory = group.get_Item(BuiltInCategory.OST_Floors)


OUT = floorCategory.Name
# ----------------------------------------
all_elements_of_category = ElementsOfCategory(all_categories_names)
watch_2 = Watch(all_elements_of_category)
all_categories = Python()  # unwired: IN[0]
# ---------- all_categories.python (36 lines) ----------
import clr

# Import DocumentManager and TransactionManager
clr.AddReference("RevitServices")
import RevitServices
from RevitServices.Persistence import DocumentManager

# Import RevitAPI
clr.AddReference("RevitAPI")
import Autodesk
from Autodesk.Revit.DB import *

documentSettings  = DocumentManager.Instance.CurrentDBDocument

group = doc.Settings.Categories

cat = []

for i in categoriesCollector:
	cat.append(i.Name)


collector = FilteredElementCollector(doc).WhereElementIsElementType()
Type = []

for e in collector:
	try:
		out1.append(e.ToDSType(True))
	except:
		pass

#cat = collector.OfCategory(BuiltInCategory())
#stairs = collector.OfCategory(BuiltInCategory.OST_Stairs)

#Assign your output to the OUT variable.
OUT = cat
# ----------------------------------------
all_categories_2 = Python()  # unwired: IN[0]
# ---------- all_categories_2.python (27 lines) ----------
import clr

# Import DocumentManager and TransactionManager
clr.AddReference("RevitServices")
import RevitServices
from RevitServices.Persistence import DocumentManager

# Import RevitAPI
clr.AddReference("RevitAPI")
import Autodesk
from Autodesk.Revit.DB import *

documentSettings = DocumentManager.Instance.CurrentDBDocument

group = documentSettings.Settings.Categories

groupName = []

for i in group:
	groupName.append(i.Name)

#OUT = "Number of all categories in current Revit document:" + str(group.Size)

floorCategory = group.get_Item(BuiltInCategory.OST_Floors)


OUT = floorCategory
# ----------------------------------------
all_floor_types = Python()  # unwired: IN[0]
# ---------- all_floor_types.python (23 lines) ----------
import clr

# Import DocumentManager and TransactionManager
clr.AddReference("RevitServices")
import RevitServices
from RevitServices.Persistence import DocumentManager

# Import RevitAPI
clr.AddReference("RevitAPI")
import Autodesk
from Autodesk.Revit.DB import *

doc = DocumentManager.Instance.CurrentDBDocument

collector = FilteredElementCollector(doc).OfCategory(BuiltInCategory.OST_Floors)

floorElements = []

for floor in collector:
	floorElements.append(floor)


OUT = floorElements
# ----------------------------------------
