# Dynamo graph Re_align_test.0.1 - Copy.dyn (Dynamo 1.3.1.1736)

switch = DSModelElementSelection()  # 1 picked in the model
getLocation = Element.GetLocation(switch)
select_equipment = DSModelElementSelection()  # 1 picked in the model
category = Custom[Element.Category](element=select_equipment)  # Returns the category of a given element
all_elements_of_category = ElementsOfCategory(category)
code_block = CodeBlock { "Family"; }
getParameterValueByName = Element.GetParameterValueByName(element=select_equipment, parameterName=code_block)
code_block_2 = CodeBlock { "Family Name"; }
getParameterValueByName_2 = Element.GetParameterValueByName(element=getParameterValueByName, parameterName=code_block_2)
code_block_3 = CodeBlock { "Family"; }
getParameterValueByName_3 = Element.GetParameterValueByName(element=all_elements_of_category, parameterName=code_block_3)
watch = Watch(getParameterValueByName_3)
code_block_4 = CodeBlock { "Family Name"; }
getParameterValueByName_4 = Element.GetParameterValueByName(element=watch, parameterName=code_block_4)
eq = getParameterValueByName_2 == getParameterValueByName_4
watch_2 = Watch(eq)
filterByBoolMask = List.FilterByBoolMask(list=all_elements_of_category, mask=watch_2)
watch_3 = Watch(filterByBoolMask.in)
code_block_5 = CodeBlock { "Identity_ID_Equipment Served By"; }
getParameterValueByName_5 = Element.GetParameterValueByName(element=watch_3, parameterName=code_block_5)
byID = Custom[Element.ByID](ID_UniqueId=getParameterValueByName_5)  # Gets the Revit element(s) for a list of IDs (or a single ID)
watch_4 = Watch(byID.element)
eq_2 = watch_4 == switch
filterByBoolMask_2 = List.FilterByBoolMask(list=watch_4, mask=eq_2)

# group: Electrical Fixture Location
watch_5 = Watch(filterByBoolMask_2.out)
getLocation_2 = Element.GetLocation(watch_5)

# group: Find the electrical connector location
mep_connector_info = Custom[MEP connector info](Element=watch_3)  # Returns location, connector info and connected elements
code_block_6 = CodeBlock { "DomainElectrical"; }
contains = String.Contains(str=mep_connector_info.Info, searchFor=code_block_6, lacing=Longest)
filterByBoolMask_3 = List.FilterByBoolMask(list=mep_connector_info.Points, mask=contains)
flatten = Flatten(filterByBoolMask_3.in)

# group: Vector Transaction
byTwoPoints = Vector.ByTwoPoints(start=getLocation_2, end=flatten)

# group: This node has a bug so you need to start and end a transaction before and after
start = Revit.Transaction.Transaction.Start(watch_5)
moveByVector = Element.MoveByVector(start, byTwoPoints)
end = Revit.Transaction.Transaction.End(moveByVector)
