# Dynamo graph Reinf Drawing Number.dyn (Dynamo 0.8.2.2392)

# group: TOP REINFORCEMENT DRAWING NUMBER
family_types = FamilyTypes("Top Reinforcement Drawing Number:Top Reinforcement Drawing Number")

all_elements_of_family_type = ElementsOfFamilyType(family_types)
code_block = CodeBlock { "Top Reinf Drawing Number"; }
parameters = Element.Parameters(all_elements_of_family_type)
string_from_object = FromObject(parameters)
code_block_2 = CodeBlock { "Workset"; }
contains = String.Contains(str=string_from_object, searchFor=code_block_2)
filterByBoolMask = List.FilterByBoolMask(list=string_from_object, mask=contains)
flatten = Flatten(filterByBoolMask.in)
python_script = Python(IN[0]=flatten)
# ---------- python_script.python (18 lines) ----------
import clr
clr.AddReference('ProtoGeometry')
from Autodesk.DesignScript.Geometry import *

import re


#The inputs to this node will be stored as a list in the IN variables.
str = IN[0]

digits = []

for i in str:
	digits.append(re.findall("[0-9]+", i))
	

#Assign your output to the OUT variable.
OUT = digits
# ----------------------------------------
code_block_3 = CodeBlock { 0; }
getItemAtIndex = List.GetItemAtIndex(index=code_block_3)
map = List.Map(list=python_script, f_x=getItemAtIndex)
toNumber = String.ToNumber(map)
code_block_4 = CodeBlock(a=toNumber) { a+10; }
string_from_object_2 = FromObject(code_block_4)
setParameterByName = Element.SetParameterByName(element=all_elements_of_family_type, parameterName=code_block, value=string_from_object_2)

# group: BOTTOM REINFORCEMENT DRAWING NUMBER
family_types_2 = FamilyTypes("Bottom Reinforcement Drawing Number:Bottom Reinforcement Drawing Number")

all_elements_of_family_type_2 = ElementsOfFamilyType(family_types_2)
code_block_5 = CodeBlock { "Bottom Reinf Drawing Number"; }
parameters_2 = Element.Parameters(all_elements_of_family_type_2)
string_from_object_3 = FromObject(parameters_2)
code_block_6 = CodeBlock { "Workset"; }
contains_2 = String.Contains(str=string_from_object_3, searchFor=code_block_6)
filterByBoolMask_2 = List.FilterByBoolMask(list=string_from_object_3, mask=contains_2)
flatten_2 = Flatten(filterByBoolMask_2.in)
python_script_2 = Python(IN[0]=flatten_2)  # same code as python_script
code_block_7 = CodeBlock { 0; }
getItemAtIndex_2 = List.GetItemAtIndex(index=code_block_7)
map_2 = List.Map(list=python_script_2, f_x=getItemAtIndex_2)
toNumber_2 = String.ToNumber(map_2)
code_block_8 = CodeBlock(a=toNumber_2) { a-10; }
string_from_object_4 = FromObject(code_block_8)
setParameterByName_2 = Element.SetParameterByName(element=all_elements_of_family_type_2, parameterName=code_block_5, value=string_from_object_4)
code_block_9 = CodeBlock { a; }
