# Dynamo graph Combine text.dyn (Dynamo 0.8.2.2392)

code_block = CodeBlock { a; }
code_block_2 = CodeBlock { List.Reverse(a); b; }
python_script = Python(IN[0]=code_block_2.b)
# ---------- python_script.python (12 lines) ----------
import clr
clr.AddReference('RevitAPI')
from Autodesk.Revit.DB import *

textnotes = UnwrapElement(IN[0])
elementlist = list()
for item in textnotes:
	try:
		elementlist.append(item.Text)
	except:
		elementlist.append(list())
OUT = elementlist
# ----------------------------------------
code_block_3 = CodeBlock { "Add"; }
code_block_4 = CodeBlock { 1; }
contains = String.Contains(str=python_script, searchFor=code_block_3, ignoreCase=code_block_4)
filterByBoolMask = List.FilterByBoolMask(list=code_block, mask=contains)
python_script_2 = Python(IN[0]=code_block_2.out0)  # same code as python_script
code_block_5 = CodeBlock(a=python_script_2) { a[0]+a[1]+" "+a[2]; }
string_from_object = FromObject(code_block_5)
setText = Custom[TextElement.SetText](element=filterByBoolMask.in, text=string_from_object)  # Sets the text of a given text element (i.e. text note or model text)
reverse = List.Reverse()
code_block_6 = CodeBlock(a=reverse) { a[0]; }
restOfItems = List.RestOfItems(code_block_6)
deleteElements = Custom[Doc.DeleteElements](element_s=restOfItems)  # Attempts to delete the input list of elements from the active Revit document.The node returns the number of successfully deleted elements and their Ids as a string. Carefully observe the deleted elements count. It may be greater than the input list because hosted elements or tags will be deleted as well. If an element in the list can not be deleted (for example last revision or last view), the whole list will fail to be deleted.
select_model_elements = DSModelElementsSelection()  # 1 picked in the model
python_script_3 = Python(IN[0]=select_model_elements)  # same code as python_script
setText_2 = Custom[TextElement.SetText]()
python_script_4 = Python()
# ---------- python_script_4.python (31 lines) ----------
import clr
clr.AddReference('RevitAPI')
from Autodesk.Revit.DB import *

clr.AddReference("RevitNodes")
import Revit
clr.ImportExtensions(Revit.Elements)

clr.AddReference("RevitServices")
import RevitServices
from RevitServices.Persistence import DocumentManager
from RevitServices.Transactions import TransactionManager

doc = DocumentManager.Instance.CurrentDBDocument
items = UnwrapElement(IN[0])
texts = IN[1]
goodlist = list()
badlist = list()
counter = 0

TransactionManager.Instance.EnsureInTransaction(doc)
while counter < len(items):
	try:
		items[counter].Text = texts[counter]
		goodlist.append(items[counter])
	except:
		badlist.append(items[counter])
	counter += 1
TransactionManager.Instance.TransactionTaskDone()

OUT = (goodlist,badlist)
# ----------------------------------------
select_model_elements_2 = DSModelElementsSelection()  # 1 picked in the model
code_block_7 = CodeBlock(a=select_model_elements_2) { a; }
code_block_8 = CodeBlock { 3; }
chop = List.Chop(code_block_7, code_block_8)
firstItem = List.FirstItem(chop, lacing=Longest)
python_script_5 = Python(IN[0]=code_block_7)  # same code as python_script
chop_2 = List.Chop(python_script_5, code_block_8)
python_script_6 = Python(IN[0]=chop_2)
# ---------- python_script_6.python (12 lines) ----------
import clr
clr.AddReference('ProtoGeometry')
from Autodesk.DesignScript.Geometry import *
#The inputs to this node will be stored as a list in the IN variables.
text = IN[0]
newT = []

for a in text:
	newT.append(a[0]+a[1]+" "+a[2])

#Assign your output to the OUT variable.
OUT = newT
# ----------------------------------------
string_from_object_2 = FromObject(python_script_6)
python_script_7 = Python(IN[0]=firstItem, IN[1]=string_from_object_2)
# ---------- python_script_7.python (28 lines) ----------
import clr
clr.AddReference('RevitAPI')
from Autodesk.Revit.DB import *

clr.AddReference("RevitNodes")
import Revit
clr.ImportExtensions(Revit.Elements)

clr.AddReference("RevitServices")
import RevitServices
from RevitServices.Persistence import DocumentManager
from RevitServices.Transactions import TransactionManager

doc = DocumentManager.Instance.CurrentDBDocument
items = UnwrapElement(IN[0])
texts = IN[1]
goodlist = list()
badlist = list()
counter = 0

TransactionManager.Instance.EnsureInTransaction(doc)
for i in range(0,len(items)):
	items[i].Text = texts[i]
	goodlist.append(items[i])
	
TransactionManager.Instance.TransactionTaskDone()

OUT = goodlist
# ----------------------------------------
python_script_8 = Python(IN[0]=select_model_elements_2)  # same code as python_script
reverse_2 = List.Reverse(select_model_elements_2)
select_model_elements_3 = DSModelElementsSelection()  # 2 picked in the model
