# Dynamo graph Delete by Area.dyn (Dynamo 0.8.2.2392)

select_model_elements = DSModelElementsSelection()  # 117 picked in the model
python_script = Python(IN[0]=select_model_elements)
# ---------- python_script.python (12 lines) ----------
import clr
clr.AddReference('RevitAPI')
from Autodesk.Revit.DB import *

faminsts = UnwrapElement(IN[0])
elementlist = list()
for item in faminsts:
	try:
		elementlist.append(item.Area)
	except:
		elementlist.append(list())
OUT = elementlist
# ----------------------------------------
geometry = Element.Geometry(select_model_elements)
string_from_object = FromObject(geometry)
code_block = CodeBlock { "Surface"; }
contains = String.Contains(str=string_from_object, searchFor=code_block)
filterByBoolMask = List.FilterByBoolMask(list=geometry, mask=contains)
code_block_2 = CodeBlock(a=filterByBoolMask.in) { Flatten(a); }
area = Surface.Area(code_block_2)
code_block_3 = CodeBlock(a=area) { a==15000; }
filterByBoolMask_2 = List.FilterByBoolMask(list=filterByBoolMask.in, mask=code_block_3)
code_block_4 = CodeBlock(a=filterByBoolMask_2.in) { Flatten(a); }
deleteElements = Custom[Doc.DeleteElements]()  # Attempts to delete the input list of elements from the active Revit document.The node returns the number of successfully deleted elements and their Ids as a string. Carefully observe the deleted elements count. It may be greater than the input list because hosted elements or tags will be deleted as well. If an element in the list can not be deleted (for example last revision or last view), the whole list will fail to be deleted.
