# Dynamo graph Place text rebar end.dyn (Dynamo 0.8.2.2392)

code_block = CodeBlock { 1; }
active_view = Custom[Active View](refresh=code_block)
select_model_elements = DSModelElementsSelection()  # 42 picked in the model
geometry = Element.Geometry(select_model_elements)
code_block_2 = CodeBlock(a=geometry) { a.Length>2000; }
flatten = Flatten(code_block_2)
filterByBoolMask = List.FilterByBoolMask(list=select_model_elements, mask=flatten)
geometry_2 = Element.Geometry(filterByBoolMask.in)
code_block_3 = CodeBlock(a=geometry_2) { Flatten(a); }
direction = Line.Direction(code_block_3)
normalized = Vector.Normalized(direction)
code_block_4 = CodeBlock(a=normalized) { a.X==0; }

# group: Vertical Bars
filterByBoolMask_2 = List.FilterByBoolMask(list=geometry_2, mask=code_block_4)

code_block_5 = CodeBlock(a=filterByBoolMask_2.out) { Flatten(a); }
startPoint = Curve.StartPoint(code_block_5)
endPoint = Curve.EndPoint(code_block_5)
create = List.Create(startPoint, endPoint)
flatten_2 = Flatten(create)
XAxis = Vector.XAxis()
ZAxis = Vector.ZAxis()
code_block_6 = CodeBlock { 0; }
rotate = Vector.Rotate(XAxis, ZAxis, code_block_6)
code_block_7 = CodeBlock { -90; }
rotate_2 = Vector.Rotate(rotate, ZAxis, code_block_7)
code_block_8 = CodeBlock { "TL"; }
code_block_9 = CodeBlock { 0.05; }
center = Custom[TextAlignFlags.Center]()  # Returns the "Left" text align flag.
python_script = Python(IN[0]=active_view, IN[1]=flatten_2, IN[2]=rotate, IN[3]=rotate_2, IN[4]=code_block_8, IN[5]=code_block_9, IN[6]=center)
# ---------- python_script.python (33 lines) ----------
import clr
clr.AddReference('RevitAPI')
from Autodesk.Revit.DB import *

clr.AddReference("RevitNodes")
import Revit
clr.ImportExtensions(Revit.GeometryConversion)

clr.AddReference("RevitServices")
import RevitServices
from RevitServices.Persistence import DocumentManager
from RevitServices.Transactions import TransactionManager

doc = DocumentManager.Instance.CurrentDBDocument
view = UnwrapElement(IN[0])
xyzlist = [x.ToXyz() for x in IN[1]]
basevecs = UnwrapElement(IN[2])
upvecs = UnwrapElement(IN[3])
text = IN[4]
width = IN[5]
textalign = IN[6]
doccreation = doc.Create
counter = 0
elementlist = list()

TransactionManager.Instance.EnsureInTransaction(doc)

for item in xyzlist:
	elementlist.append(doccreation.NewTextNote(view,item, basevecs.ToXyz(), upvecs.ToXyz(), width, textalign,text))
	
TransactionManager.Instance.TransactionTaskDone()

OUT = elementlist,basevecs.ToXyz(),XYZ.BasisX
# ----------------------------------------
code_block_10 = CodeBlock { 1; }
active_view_2 = Custom[Active View](refresh=code_block_10)
code_block_11 = CodeBlock(a=filterByBoolMask_2.in) { Flatten(a); }
startPoint_2 = Curve.StartPoint(code_block_11)
endPoint_2 = Curve.EndPoint(code_block_11)
create_2 = List.Create(startPoint_2, endPoint_2)
flatten_3 = Flatten(create_2)
XAxis_2 = Vector.XAxis()
ZAxis_2 = Vector.ZAxis()
code_block_12 = CodeBlock { 90; }
rotate_3 = Vector.Rotate(XAxis_2, ZAxis_2, code_block_12)
code_block_13 = CodeBlock { -90; }
rotate_4 = Vector.Rotate(rotate_3, ZAxis_2, code_block_13)
code_block_14 = CodeBlock { "TL"; }
code_block_15 = CodeBlock { 0.05; }
center_2 = Custom[TextAlignFlags.Center]()
python_script_2 = Python(IN[0]=active_view_2, IN[1]=flatten_3, IN[2]=rotate_3, IN[3]=rotate_4, IN[4]=code_block_14, IN[5]=code_block_15, IN[6]=center_2)  # same code as python_script
flatten_4 = Flatten(geometry)
