# Dynamo graph Select Circles.dyn (Dynamo 0.8.2.2392)

select_model_elements = DSModelElementsSelection()  # 1 picked in the model
geometry = Element.Geometry(select_model_elements)
flatten = Flatten(geometry)
byPatch = Surface.ByPatch(flatten)
perimeterCurves = Surface.PerimeterCurves(byPatch)
flatten_2 = Flatten(perimeterCurves)
code_block = CodeBlock { "Solid Black"; }
python_script = Python(IN[0]=flatten_2, IN[1]=code_block)
# ---------- python_script.python (30 lines) ----------
import clr
clr.AddReference("ProtoGeometry")
from Autodesk.DesignScript.Geometry import *

clr.AddReference("RevitAPI")
import Autodesk
from Autodesk.Revit.DB import *
 
clr.AddReference("RevitServices")
import RevitServices
from RevitServices.Persistence import DocumentManager
from RevitServices.Transactions import TransactionManager


doc =  DocumentManager.Instance.CurrentDBDocument
uiapp = DocumentManager.Instance.CurrentUIApplication
app = uiapp.Application

def lineFromCrv(crv):
	return Autodesk.Revit.DB.Line.CreateBound(crv)

regions = []
activeViewId = doc.ActiveView.Id
 
TransactionManager.Instance.EnsureInTransaction(doc)


TransactionManager.Instance.TransactionTaskDone()
 
OUT = lineFromCrv(IN[0])
# ----------------------------------------
element_types = ElementTypes("FilledRegionType")
all_elements_of_type = ElementsOfType(element_types)
name = Element.Name(all_elements_of_type)
code_block_2 = CodeBlock { 0; }
contains = String.Contains(str=name, searchFor=code_block, ignoreCase=code_block_2)
filterByBoolMask = List.FilterByBoolMask(list=all_elements_of_type, mask=contains)
name_2 = Element.Name(filterByBoolMask.in)
python_script_2 = Python()
# ---------- python_script_2.python (40 lines) ----------
import clr
 
 clr.AddReference("RevitAPI")
 from Autodesk.Revit.DB import *
 
 clr.AddReference("RevitServices")
 from RevitServices.Persistence import DocumentManager
 from RevitServices.Transactions import TransactionManager
 
 doc =  DocumentManager.Instance.CurrentDBDocument
 
 roomsList =  UnwrapElement(IN[0])
 filledRegionName = IN[1]
 
 for fr in FilteredElementCollector(doc).OfClass(FilledRegionType):
     if Element.Name.GetValue(fr) == filledRegionName:
         filledRegion = fr
         break     
 
 viewId = doc.ActiveView.Id
 
 TransactionManager.Instance.EnsureInTransaction(doc)
 
 regions = []
 for room in roomsList:  
     if room.Area > 0:
         roomBoundaries = room.GetBoundarySegments(SpatialElementBoundaryOptions())            
         curveLoopList = []
         roomCurves = CurveLoop()
         for roomBoundary in roomBoundaries:
             for boundarySegment in roomBoundary:
                 roomCurves.Append(boundarySegment.Curve)
         curveLoopList.Add(roomCurves)
 
         region = FilledRegion.Create(doc,filledRegion.Id,viewId, curveLoopList)
         regions.append(region)    
     
 TransactionManager.Instance.TransactionTaskDone()
 
 OUT = regions
# ----------------------------------------
select_model_elements_2 = DSModelElementsSelection()  # 53 picked in the model
geometry_2 = Element.Geometry(select_model_elements_2)
flatten_3 = Flatten(geometry_2)
class_ = Custom[Object.Class](obj=flatten_3)  # Gets the input object's class name. Can process lists.
code_block_3 = CodeBlock { "Circle"; }
code_block_4 = CodeBlock { 1; }
contains_2 = String.Contains(str=class_.class_str, searchFor=code_block_3, ignoreCase=code_block_4)
filterByBoolMask_2 = List.FilterByBoolMask(list=select_model_elements_2, mask=contains_2)
simplify = Custom[CurveLoop.Simplify](curveLoop=filterByBoolMask_2.in)  # Attempts to simplify an open or a closed curve loop by connecting straight separate line segments into a single line.
code_block_5 = CodeBlock(a=filterByBoolMask_2.in) { a[0]; }
python_script_3 = Python()
# ---------- python_script_3.python (50 lines) ----------
#Copyright(c) 2015, Konrad K Sobon
# @arch_laboratory, http://archi-lab.net

import clr
clr.AddReference('ProtoGeometry')
from Autodesk.DesignScript.Geometry import *

# Import DocumentManager and TransactionManager
clr.AddReference("RevitServices")
import RevitServices
from RevitServices.Persistence import DocumentManager
from RevitServices.Transactions import TransactionManager

# Import RevitAPI
clr.AddReference("RevitAPI")
import Autodesk
from Autodesk.Revit.DB import *
from Autodesk.Revit.DB.Analysis import *

doc = DocumentManager.Instance.CurrentDBDocument
uiapp = DocumentManager.Instance.CurrentUIApplication
app = uiapp.Application

# Import ToDSType(bool) extension method
clr.AddReference("RevitNodes")
import Revit
clr.ImportExtensions(Revit.Elements)

# Import ToProtoType, ToRevitType geometry conversion extension methods
clr.ImportExtensions(Revit.GeometryConversion)

#The inputs to this node will be stored as a list in the IN variable.
dataEnteringNode = IN
filledRegions = UnwrapElement(IN[0])

def process_list(_func, _list):
    return map( lambda x: process_list(_func, x) if type(x)==list else _func(x), _list )

def ToDSType(item):
	curves = []
	for i in item:
		curves.append(i.ToProtoType())
	return curves

curves = []
for i in filledRegions:
	curves.append(process_list(ToDSType, i.GetBoundaries()))

#Assign your output to the OUT variable
OUT = curves
# ----------------------------------------
patch = Curve.Patch()
