# Dynamo graph Select Circles01.dyn (Dynamo 0.8.2.2392)

code_block = CodeBlock { "Filled region 1"; }
python_script = Python(IN[1]=code_block)
# ---------- python_script.python (40 lines) ----------
import clr
 
clr.AddReference("RevitAPI")
from Autodesk.Revit.DB import *
 
clr.AddReference("RevitServices")
from RevitServices.Persistence import DocumentManager
from RevitServices.Transactions import TransactionManager
 
doc =  DocumentManager.Instance.CurrentDBDocument
 
roomsList =  UnwrapElement(IN[0])
filledRegionName = IN[1]
 
for fr in FilteredElementCollector(doc).OfClass(FilledRegionType):
    if Element.Name.GetValue(fr) == filledRegionName:
        filledRegion = fr
        break     
 
viewId = doc.ActiveView.Id
 
TransactionManager.Instance.EnsureInTransaction(doc)
 
regions = []
for room in roomsList:  
    if 1 > 0:
        roomBoundaries = room.GetBoundarySegments(SpatialElementBoundaryOptions())            
        curveLoopList = []
        roomCurves = CurveLoop()
        for roomBoundary in roomBoundaries:
            for boundarySegment in roomBoundary:
                roomCurves.Append(boundarySegment.Curve)
        curveLoopList.Add(roomCurves)

        region = FilledRegion.Create(doc,filledRegion.Id,viewId, curveLoopList)
        regions.append(region)    
     
TransactionManager.Instance.TransactionTaskDone()
 
OUT = regions
# ----------------------------------------
python_script_2 = Python(IN[1]=code_block)
# ---------- python_script_2.python (50 lines) ----------
import clr
clr.AddReference("ProtoGeometry")
from Autodesk.DesignScript.Geometry import *

clr.AddReference("RevitAPI")
import Autodesk
from Autodesk.Revit.DB import *
 
clr.AddReference("RevitServices")
import RevitServices
from RevitServices.Persistence import DocumentManager
from RevitServices.Transactions import TransactionManager
 
doc =  DocumentManager.Instance.CurrentDBDocument
 
roomsList =  UnwrapElement(IN[0])
filledRegionName = IN[1]
 
for fr in FilteredElementCollector(doc).OfClass(FilledRegionType):
    if Element.Name.GetValue(fr) == filledRegionName:
        filledRegion = fr
        break     
 
activeViewId = doc.ActiveView.Id
 
def lineFromCrv(crv):
	start = crv.StartPoint
	end = crv.EndPoint
	a = XYZ(start.X,start.Y,start.Z)
	b = XYZ(end.X,end.Y,end.Z)
	return Autodesk.Revit.DB.Line.CreateBound(a,b)


TransactionManager.Instance.EnsureInTransaction(doc)
 
regions = []

for bound in IN[0]:
	profileLoops = []
	profileLoop = CurveLoop()
	for crv in bound:
		profileLoop.Append(lineFromCrv(crv))
	profileLoops.Add(profileLoop)
	region = FilledRegion.Create(doc,filledRegion.Id,activeViewId,profileLoops)
	regions.Add(region)


TransactionManager.Instance.TransactionTaskDone()
 
OUT = regions
# ----------------------------------------
select_model_elements = DSModelElementsSelection()
curves = Element.Curves(select_model_elements)
code_block_2 = CodeBlock { 2; }
divideEqually = Curve.DivideEqually(curves, code_block_2)
python_script_3 = Python()  # same code as python_script_2
flatten = Flatten(curves)
code_block_3 = CodeBlock { 4; }
chop = List.Chop(flatten, code_block_3)
simplify = Custom[CurveLoop.Simplify](curveLoop=chop)  # Attempts to simplify an open or a closed curve loop by connecting straight separate line segments into a single line.
byJoinedCurves = PolyCurve.ByJoinedCurves(simplify)
byPatch = Surface.ByPatch(byJoinedCurves)
perimeterCurves = Surface.PerimeterCurves(byPatch)
create = List.Create(select_model_elements)
select_model_element = DSModelElementSelection()
curves_2 = Element.Curves(select_model_elements)
code_block_4 = CodeBlock { 20; }
divideEqually_2 = Curve.DivideEqually(curves_2, code_block_4)
create_2 = List.Create(divideEqually_2)
code_block_5 = CodeBlock { 0; }
python_script_4 = Python(IN[0]=divideEqually_2, IN[1]=code_block)  # same code as python_script_2
fromCurve = Custom[RoomSeparator.FromCurve]()  # Creates room separation lines from geometry curves.
active_view = Custom[Active View]()
plane = Custom[View.Plane](view=active_view)  # Retrieves the plane of a given view
flatten_2 = Flatten(curves_2)
create_3 = List.Create(active_view)
python_script_5 = Python(IN[0]=create_3)
# ---------- python_script_5.python (20 lines) ----------
import clr
clr.AddReference('RevitAPI')
from Autodesk.Revit.DB import *

clr.AddReference("RevitNodes")
import Revit
clr.ImportExtensions(Revit.GeometryConversion)

items = UnwrapElement(IN[0])
elementlist = list()
olist = list()
dlist = list()

for item in items:
	try:
		olist.append(item.Origin.ToPoint())
		dlist.append(item.ViewDirection.ToVector())
	except:
		elementlist.append(list())
OUT = (olist,dlist)
# ----------------------------------------
code_block_6 = CodeBlock(seq=python_script_5) { Plane.ByOriginNormal(seq[0],seq[1]); }
byPlane = SketchPlane.ByPlane(code_block_6)
code_block_7 = CodeBlock(a=byPlane) { a[0]; }
python_script_6 = Python(IN[0]=flatten_2, IN[1]=code_block_7, IN[2]=active_view)
# ---------- python_script_6.python (30 lines) ----------
import clr
clr.AddReference('RevitAPI')
from Autodesk.Revit.DB import *

clr.AddReference("RevitNodes")
import Revit
clr.ImportExtensions(Revit.GeometryConversion)

clr.AddReference("RevitServices")
import RevitServices
from RevitServices.Persistence import DocumentManager
from RevitServices.Transactions import TransactionManager

doc = DocumentManager.Instance.CurrentDBDocument
curves = UnwrapElement(IN[0])
sketchplane = UnwrapElement(IN[1])
view = UnwrapElement(IN[2])

TransactionManager.Instance.EnsureInTransaction(doc)
curvearray = CurveArray()
for curve in curves:
	curvearray.Append(curve.ToRevitType())
doccreation = doc.Create
separatorarray = doccreation.NewRoomBoundaryLines(sketchplane, curvearray, view)
TransactionManager.Instance.TransactionTaskDone()

elementlist = list()
for item in separatorarray:
	elementlist.append(item)
OUT = elementlist
# ----------------------------------------
code_block_8 = CodeBlock { 4; }
chop_2 = List.Chop(python_script_6, code_block_8)
python_script_7 = Python(IN[0]=chop_2, IN[1]=code_block)  # same code as python_script_2
