# Dynamo graph Select Circles02.dyn (Dynamo 0.8.2.2392)

python_script = Python()
# ---------- python_script.python (40 lines) ----------
import clr
 
clr.AddReference("RevitAPI")
from Autodesk.Revit.DB import *
 
clr.AddReference("RevitServices")
from RevitServices.Persistence import DocumentManager
from RevitServices.Transactions import TransactionManager
 
doc =  DocumentManager.Instance.CurrentDBDocument
 
roomsList =  UnwrapElement(IN[0])
filledRegionName = IN[1]
 
for fr in FilteredElementCollector(doc).OfClass(FilledRegionType):
    if Element.Name.GetValue(fr) == filledRegionName:
        filledRegion = fr
        break     
 
viewId = doc.ActiveView.Id
 
TransactionManager.Instance.EnsureInTransaction(doc)
 
regions = []
for room in roomsList:  
    if 1 > 0:
        roomBoundaries = room.GetBoundarySegments(SpatialElementBoundaryOptions())            
        curveLoopList = []
        roomCurves = CurveLoop()
        for roomBoundary in roomBoundaries:
            for boundarySegment in roomBoundary:
                roomCurves.Append(boundarySegment.Curve)
        curveLoopList.Add(roomCurves)

        region = FilledRegion.Create(doc,filledRegion.Id,viewId, curveLoopList)
        regions.append(region)    
     
TransactionManager.Instance.TransactionTaskDone()
 
OUT = regions
# ----------------------------------------
select_model_elements = DSModelElementsSelection()  # 20 picked in the model
curves = Element.Curves(select_model_elements)
flatten = Flatten(curves)
code_block = CodeBlock { 4; }
chop = List.Chop(flatten, code_block)
simplify = Custom[CurveLoop.Simplify](curveLoop=chop)  # Attempts to simplify an open or a closed curve loop by connecting straight separate line segments into a single line.
code_block_2 = CodeBlock { "Filled region 1"; }
python_script_2 = Python(IN[0]=simplify, IN[1]=code_block_2)
# ---------- python_script_2.python (50 lines) ----------
import clr
clr.AddReference("ProtoGeometry")
from Autodesk.DesignScript.Geometry import *

clr.AddReference("RevitAPI")
import Autodesk
from Autodesk.Revit.DB import *
 
clr.AddReference("RevitServices")
import RevitServices
from RevitServices.Persistence import DocumentManager
from RevitServices.Transactions import TransactionManager
 
doc =  DocumentManager.Instance.CurrentDBDocument
 
roomsList =  UnwrapElement(IN[0])
filledRegionName = IN[1]
 
for fr in FilteredElementCollector(doc).OfClass(FilledRegionType):
    if Element.Name.GetValue(fr) == filledRegionName:
        filledRegion = fr
        break     
 
activeViewId = doc.ActiveView.Id
 
def lineFromCrv(crv):
	start = crv.StartPoint
	end = crv.EndPoint
	a = XYZ(start.X,start.Y,start.Z)
	b = XYZ(end.X,end.Y,end.Z)
	return Autodesk.Revit.DB.Line.CreateBound(a,b)


TransactionManager.Instance.EnsureInTransaction(doc)
 
regions = []

for bound in IN[0]:
	profileLoops = []
	profileLoop = CurveLoop()
	for crv in bound:
		profileLoop.Append(lineFromCrv(crv))
	profileLoops.Add(profileLoop)
	region = FilledRegion.Create(doc,filledRegion.Id,activeViewId,profileLoops)
	regions.Add(region)


TransactionManager.Instance.TransactionTaskDone()
 
OUT = regions
# ----------------------------------------
code_block_3 = CodeBlock { 2; }
divideEqually = Curve.DivideEqually(arg1=code_block_3)
python_script_3 = Python()  # same code as python_script_2
create = List.Create()
select_model_element = DSModelElementSelection()
code_block_4 = CodeBlock { 0; }
active_view = Custom[Active View]()
plane = Custom[View.Plane](view=active_view)  # Retrieves the plane of a given view
flatten_2 = Flatten()
create_2 = List.Create(active_view)
python_script_4 = Python(IN[0]=create_2)
# ---------- python_script_4.python (20 lines) ----------
import clr
clr.AddReference('RevitAPI')
from Autodesk.Revit.DB import *

clr.AddReference("RevitNodes")
import Revit
clr.ImportExtensions(Revit.GeometryConversion)

items = UnwrapElement(IN[0])
elementlist = list()
olist = list()
dlist = list()

for item in items:
	try:
		olist.append(item.Origin.ToPoint())
		dlist.append(item.ViewDirection.ToVector())
	except:
		elementlist.append(list())
OUT = (olist,dlist)
# ----------------------------------------
code_block_5 = CodeBlock(seq=python_script_4) { Plane.ByOriginNormal(seq[0],seq[1]); }
byPlane = SketchPlane.ByPlane(code_block_5)
code_block_6 = CodeBlock(a=byPlane) { a[0]; }
python_script_5 = Python(IN[0]=flatten_2, IN[1]=code_block_6, IN[2]=active_view)
# ---------- python_script_5.python (30 lines) ----------
import clr
clr.AddReference('RevitAPI')
from Autodesk.Revit.DB import *

clr.AddReference("RevitNodes")
import Revit
clr.ImportExtensions(Revit.GeometryConversion)

clr.AddReference("RevitServices")
import RevitServices
from RevitServices.Persistence import DocumentManager
from RevitServices.Transactions import TransactionManager

doc = DocumentManager.Instance.CurrentDBDocument
curves = UnwrapElement(IN[0])
sketchplane = UnwrapElement(IN[1])
view = UnwrapElement(IN[2])

TransactionManager.Instance.EnsureInTransaction(doc)
curvearray = CurveArray()
for curve in curves:
	curvearray.Append(curve.ToRevitType())
doccreation = doc.Create
separatorarray = doccreation.NewRoomBoundaryLines(sketchplane, curvearray, view)
TransactionManager.Instance.TransactionTaskDone()

elementlist = list()
for item in separatorarray:
	elementlist.append(item)
OUT = elementlist
# ----------------------------------------
code_block_7 = CodeBlock { 4; }
chop_2 = List.Chop(python_script_5, code_block_7)
code_block_8 = CodeBlock { "Filled region 1"; }
python_script_6 = Python(IN[0]=chop_2, IN[1]=code_block_8)  # same code as python_script_2
