# Dynamo graph Set Line Style.dyn (Dynamo 0.8.2.2392)

select_model_elements = DSModelElementsSelection()  # 1560 picked in the model

# group: LENGTH
geometry = Element.Geometry(select_model_elements)
flatten = Flatten(geometry)

string_from_object = FromObject(flatten)
code_block = CodeBlock { "Line"; }
code_block_2 = CodeBlock { 1; }
contains = String.Contains(str=string_from_object, searchFor=code_block, ignoreCase=code_block_2)
filterByBoolMask = List.FilterByBoolMask(list=flatten, mask=contains)

# group (continued): LENGTH
code_block_3 = CodeBlock(a=filterByBoolMask.in) { a.Length; }
code_block_4 = CodeBlock(a=code_block_3) { a==942.5; }

deleteElements = Custom[Doc.DeleteElements]()  # Attempts to delete the input list of elements from the active Revit document.The node returns the number of successfully deleted elements and their Ids as a string. Carefully observe the deleted elements count. It may be greater than the input list because hosted elements or tags will be deleted as well. If an element in the list can not be deleted (for example last revision or last view), the whole list will fail to be deleted.
code_block_5 = CodeBlock { 353; }
eq = code_block_3 == code_block_5
filterByBoolMask_2 = List.FilterByBoolMask(list=select_model_elements, mask=contains)
ceiling = Math.Ceiling(code_block_3)
code_block_6 = CodeBlock(a=ceiling) { a==354; }

# group (continued): LENGTH
filterByBoolMask_3 = List.FilterByBoolMask(list=filterByBoolMask_2.in, mask=code_block_6)

setParameterByName = Element.SetParameterByName(element=filterByBoolMask_3.in)
code_block_7 = CodeBlock { "Line Style"; }
python_script = Python()
# ---------- python_script.python (39 lines) ----------
import clr
clr.AddReference('ProtoGeometry')
from Autodesk.DesignScript.Geometry import *

# Import DocumentManager and TransactionManager
clr.AddReference("RevitServices")
import RevitServices
from RevitServices.Persistence import DocumentManager

# Import RevitAPI
clr.AddReference("RevitAPI")
import Autodesk
from Autodesk.Revit.DB import *

doc = DocumentManager.Instance.CurrentDBDocument

import sys
pyt_path = r'C:\Program Files (x86)\IronPython 2.7\Lib'
sys.path.append(pyt_path)

#The inputs to this node will be stored as a list in the IN variable.
dataEnteringNode = IN

try:
	errorReport = None
	cat = doc.Settings.Categories.get_Item(BuiltInCategory.OST_Lines)
	gs = cat.GetGraphicsStyle(GraphicsStyleType.Projection)
	gsCat = gs.GraphicsStyleCategory.SubCategories
	dataOut = [i.GetGraphicsStyle(GraphicsStyleType.Projection) for i in gsCat]
except:
	# if error accurs anywhere in the process catch it
	import traceback
	errorReport = traceback.format_exc()

#Assign your output to the OUT variable
if errorReport == None:
	OUT = dataOut
else:
	OUT = errorReport
# ----------------------------------------
name = Element.Name(python_script)
code_block_8 = CodeBlock { "5 Arup Cont"; }
code_block_9 = CodeBlock { 1; }
contains_2 = String.Contains(str=name, searchFor=code_block_8, ignoreCase=code_block_9)
filterByBoolMask_4 = List.FilterByBoolMask(list=python_script, mask=contains_2)
code_block_10 = CodeBlock(a=filterByBoolMask_4.in) { Flatten(a); }
combine = List.Combine(setParameterByName, code_block_7, code_block_10)
watch = Watch(select_model_elements)
