# Dynamo graph test.dyn (Dynamo 1.2.0.2514)

select_filled_region_type = FilledRegionTypes("Filled region 1")
filled_region_boundary_curves = Custom[Filled Region Boundary Curves]()  # This node will get the boundary curves for a filled region.; unwired: Filled_Region
select_model_elements = DSModelElementsSelection()  # 25 picked in the model
curves = Element.Curves()  # unwired: arg0
code_block = CodeBlock(crv=curves) { Circle.DivideEqually(crv,2); }
active_view = Custom[Active View]()  # Selects the current document's active view. Supports more view types than the built-in option. Will be depreciated once the bult in node works with all plan types.
categories = Categories("Rooms")
all_elements_of_category = ElementsOfCategory(categories)
boundaries = Custom[Room.Boundaries](Room=all_elements_of_category)  # This node returns all Room bounding curves and elements that generated them (walls, separation lines etc).
simplify = Custom[CurveLoop.Simplify](curveLoop=boundaries.Curve)  # Attempts to simplify an open or a closed curve loop by connecting straight separate line segments into a single line.
select_filled_region_type_2 = FilledRegionTypes("Filled region 1")
byCurves = FilledRegion.ByCurves(active_view, simplify, select_filled_region_type_2)
filled_region_boundary_curves_2 = Custom[Filled Region Boundary Curves](Filled_Region=byCurves)
select_model_element = DSModelElementSelection()  # 1 picked in the model
boundaries_2 = Custom[Room.Boundaries](Room=select_model_element)
simplify_2 = Custom[CurveLoop.Simplify](curveLoop=boundaries_2.Curve)
code_block_2 = CodeBlock(a=simplify_2) { a[0]; }
python_script = Python(IN[0]=code_block_2)
# ---------- python_script.python (50 lines) ----------
#Copyright(c) 2015, Konrad K Sobon
# @arch_laboratory, http://archi-lab.net

import clr
clr.AddReference('ProtoGeometry')
from Autodesk.DesignScript.Geometry import *

# Import DocumentManager and TransactionManager
clr.AddReference("RevitServices")
import RevitServices
from RevitServices.Persistence import DocumentManager
from RevitServices.Transactions import TransactionManager

# Import RevitAPI
clr.AddReference("RevitAPI")
import Autodesk
from Autodesk.Revit.DB import *
from Autodesk.Revit.DB.Analysis import *

doc = DocumentManager.Instance.CurrentDBDocument
uiapp = DocumentManager.Instance.CurrentUIApplication
app = uiapp.Application

# Import ToDSType(bool) extension method
clr.AddReference("RevitNodes")
import Revit
clr.ImportExtensions(Revit.Elements)

# Import ToProtoType, ToRevitType geometry conversion extension methods
clr.ImportExtensions(Revit.GeometryConversion)

#The inputs to this node will be stored as a list in the IN variable.
dataEnteringNode = IN
filledRegions = UnwrapElement(IN[0])

def process_list(_func, _list):
    return map( lambda x: process_list(_func, x) if type(x)==list else _func(x), _list )

def ToDSType(item):
	curves = []
	for i in item:
		curves.append(i.ToProtoType())
	return curves

curves = []
for i in filledRegions:
	curves.append(process_list(ToDSType, i.GetBoundaries()))

#Assign your output to the OUT variable
OUT = curves
# ----------------------------------------
code_block_3 = CodeBlock { "Filled Region 1"; }
python_script_2 = Python(IN[0]=simplify_2, IN[1]=code_block_3)
# ---------- python_script_2.python (46 lines) ----------
import clr
 
clr.AddReference("RevitAPI")
from Autodesk.Revit.DB import *
 
clr.AddReference("RevitServices")
from RevitServices.Persistence import DocumentManager
from RevitServices.Transactions import TransactionManager
 
doc =  DocumentManager.Instance.CurrentDBDocument
 
roomsList =  UnwrapElement(IN[0])
filledRegionName = IN[1]
 
for fr in FilteredElementCollector(doc).OfClass(FilledRegionType):
    if Element.Name.GetValue(fr) == filledRegionName:
        filledRegion = fr
        break     
 
activeViewId = doc.ActiveView.Id
 
def lineFromCrv(crv):
	start = crv.StartPoint
	end = crv.EndPoint
	a = XYZ(start.X,start.Y,start.Z)
	b = XYZ(end.X,end.Y,end.Z)
	return Autodesk.Revit.DB.Line.CreateBound(a,b)


TransactionManager.Instance.EnsureInTransaction(doc)
 
regions = []

for bound in IN[0]:
	profileLoops = []
	profileLoop = CurveLoop()
	for crv in bound:
		profileLoop.Append(lineFromCrv(crv))
	profileLoops.Add(profileLoop)
	region = FilledRegion.Create(doc,filledRegion.Id,activeViewId,profileLoops)
	regions.Add(region)


TransactionManager.Instance.TransactionTaskDone()
 
OUT = regions
# ----------------------------------------
element_types = ElementTypes("Room")
all_elements_of_type = ElementsOfType(element_types)
python_script_3 = Python(IN[1]=select_filled_region_type_2)  # unwired: IN[0]
# ---------- python_script_3.python (50 lines) ----------
import clr
clr.AddReference("ProtoGeometry")
from Autodesk.DesignScript.Geometry import *

clr.AddReference("RevitAPI")
import Autodesk
from Autodesk.Revit.DB import *
 
clr.AddReference("RevitServices")
import RevitServices
from RevitServices.Persistence import DocumentManager
from RevitServices.Transactions import TransactionManager
 
doc =  DocumentManager.Instance.CurrentDBDocument
 
roomsList =  UnwrapElement(IN[0])
filledRegionName = IN[1]
 
for fr in FilteredElementCollector(doc).OfClass(FilledRegionType):
    if Element.Name.GetValue(fr) == filledRegionName:
        filledRegion = fr
        break     
 
activeViewId = doc.ActiveView.Id
 
def lineFromCrv(crv):
	start = crv.StartPoint
	end = crv.EndPoint
	a = XYZ(start.X,start.Y,start.Z)
	b = XYZ(end.X,end.Y,end.Z)
	return Autodesk.Revit.DB.Line.CreateBound(a,b)


TransactionManager.Instance.EnsureInTransaction(doc)
 
regions = []

for bound in IN[0]:
	profileLoops = []
	profileLoop = CurveLoop()
	for crv in bound:
		profileLoop.Append(lineFromCrv(crv))
	profileLoops.Add(profileLoop)
	region = FilledRegion.Create(doc,filledRegion.Id,activeViewId,profileLoops)
	regions.Add(region)


TransactionManager.Instance.TransactionTaskDone()
 
OUT = regions
# ----------------------------------------
