# Dynamo graph Revision Cloud Tags.dyn (Dynamo 0.8.2.2392)

categories = Categories("RevisionClouds")
all_elements_of_category = ElementsOfCategory(categories)
watch = Watch(all_elements_of_category)
categories_2 = Categories("RevisionCloudTags")
all_elements_of_category_2 = ElementsOfCategory(categories_2)
watch_2 = Watch(all_elements_of_category_2)
owner_sheet = Python(IN[0]=all_elements_of_category)
# ---------- owner_sheet.python (16 lines) ----------
import clr
clr.AddReference('RevitAPI')
from Autodesk.Revit.DB import *

clr.AddReference("RevitNodes")
import Revit
clr.ImportExtensions(Revit.Elements)

items = UnwrapElement(IN[0])
elementlist = list()
for item in items:
	try:
		elementlist.append(item.Document.GetElement(item.OwnerViewId).ToDSType(True))
	except:
		elementlist.append(list())
OUT = elementlist
# ----------------------------------------
name = Element.Name(owner_sheet)
create_annotation_tag = Custom[Create Annotation Tag]()  # This node will create an annotation tag at a given location, of given type and in a supplied view. If only single view is supplied then all tags will be created in that view.
code_block = CodeBlock { 0.5; }
pointAtParameter = Curve.PointAtParameter(param=code_block)
code_block_2 = CodeBlock { 3; }
ofRepeatedItem = List.OfRepeatedItem(item=pointAtParameter, amount=code_block_2)
flatten = Flatten(ofRepeatedItem)
copy = Custom[Element.Copy](element_s=create_annotation_tag, vector_s=flatten)  # WARNING: Do not use this node in Automatic mode! Copy the input Revit elements with the help of a translation vector, similarly to the Geometry.Translate node.
byCoordinates = Vector.ByCoordinates()
owner_sheet_2 = Python(IN[0]=all_elements_of_category_2)  # same code as owner_sheet
name_2 = Element.Name(owner_sheet_2)
code_block_3 = CodeBlock { "Comments"; }
code_block_4 = CodeBlock { "TB_Revision"; }
getParameterValueByName = Element.GetParameterValueByName(element=owner_sheet, parameterName=code_block_4)
setParameterByName = Element.SetParameterByName(element=all_elements_of_category, parameterName=code_block_3, value=getParameterValueByName)
code_block_5 = CodeBlock { "Mark"; }
code_block_6 = CodeBlock { "TB_Version"; }
getParameterValueByName_2 = Element.GetParameterValueByName(element=owner_sheet, parameterName=code_block_6)
code_block_7 = CodeBlock { 0; }
code_block_8 = CodeBlock { 2; }
remove = String.Remove(str=getParameterValueByName_2, startIndex=code_block_7, count=code_block_8)
toNumber = String.ToNumber(remove)
code_block_9 = CodeBlock(a=toNumber) { "0"+(a+1); }
setParameterByName_2 = Element.SetParameterByName(element=all_elements_of_category, parameterName=code_block_5, value=code_block_9)
code_block_10 = CodeBlock { "Revision Date"; }
getParameterValueByName_3 = Element.GetParameterValueByName(element=all_elements_of_category, parameterName=code_block_10)
