# Dynamo graph RevitApiGeometry.dyn (Dynamo 1.3.1.1736)

# group: FILLED REGION TYPE
element_types = ElementTypes("FilledRegionType")
all_elements_of_type = ElementsOfType(element_types)
code_block = CodeBlock(a=all_elements_of_type) { {a[0]}; }
code_block_2 = CodeBlock(a=code_block) { a; }

python_script = Python(IN[2]=code_block_2)  # unwired: IN[0], IN[1]
# ---------- python_script.python (57 lines) ----------
import clr
clr.AddReference('ProtoGeometry')
from Autodesk.DesignScript.Geometry import *

# Import DocumentManager and TransactionManager
clr.AddReference("RevitServices")
import RevitServices
from RevitServices.Persistence import DocumentManager
from RevitServices.Transactions import TransactionManager

# Import RevitAPI
clr.AddReference("RevitAPI")
import Autodesk
from Autodesk.Revit.DB import *

doc = DocumentManager.Instance.CurrentDBDocument
uiapp = DocumentManager.Instance.CurrentUIApplication
app = uiapp.Application


regions = []
activeViewId = doc.ActiveView.Id;

TransactionManager.Instance.EnsureInTransaction(doc)

pts = UnwrapElement(IN[0])
innerPts = UnwrapElement(IN[1])

frt = UnwrapElement(IN[2])


profileLoops = []
outerProfileLoop = CurveLoop()
#innerProfileLoop = CurveLoop()

profileLoops.Add(outerProfileLoop)
#profileLoops.Add(innerProfileLoop)


#create filled region
for i in range(0,len(pts)-1):
	outerProfileLoop.Append(Autodesk.Revit.DB.Line.CreateBound(XYZ(pts[i].X,pts[i].Y,pts[i].Z),XYZ(pts[i+1].X,pts[i+1].Y,pts[i+1].Z)))

for j in range(0,len(innerPts)):
	innerProfileLoop = CurveLoop()
	profileLoops.Add(innerProfileLoop)
	for i in range(0,len(innerPts[j])-1):
		innerProfileLoop.Append(Autodesk.Revit.DB.Line.CreateBound(XYZ(innerPts[j][i].X,innerPts[j][i].Y,innerPts[j][i].Z),XYZ(innerPts[j][i+1].X,innerPts[j][i+1].Y,innerPts[j][i+1].Z)))


region = FilledRegion.Create(doc,frt[0].Id,activeViewId,profileLoops)
regions.Add(region)

TransactionManager.Instance.TransactionTaskDone()

#Assign your outputs to the OUT variable
OUT = regions
# ----------------------------------------
python_script_2 = Python(IN[2]=code_block_2)  # unwired: IN[0], IN[1]
# ---------- python_script_2.python (58 lines) ----------
import clr
clr.AddReference('ProtoGeometry')
from Autodesk.DesignScript.Geometry import *

# Import DocumentManager and TransactionManager
clr.AddReference("RevitServices")
import RevitServices
from RevitServices.Persistence import DocumentManager
from RevitServices.Transactions import TransactionManager

# Import RevitAPI
clr.AddReference("RevitAPI")
import Autodesk
from Autodesk.Revit.DB import *

doc = DocumentManager.Instance.CurrentDBDocument
uiapp = DocumentManager.Instance.CurrentUIApplication
app = uiapp.Application


regions = []
activeViewId = doc.ActiveView.Id;

TransactionManager.Instance.EnsureInTransaction(doc)

pts = UnwrapElement(IN[0])
innerPts = UnwrapElement(IN[1])

frt = UnwrapElement(IN[2])


profileLoops = []
outerProfileLoop = CurveLoop()
#innerProfileLoop = CurveLoop()

profileLoops.Add(outerProfileLoop)
#profileLoops.Add(innerProfileLoop)

arc = Autodesk.Revit.DB.Arc.MakeBound(0,1)
"""
#create filled region
for i in range(0,len(pts)):
	outerProfileLoop.Append(Autodesk.Revit.DB.Line.CreateBound(pts[i][0],pts[i][1]))
"""
for j in range(0,len(innerPts)):
	innerProfileLoop = CurveLoop()
	profileLoops.Add(innerProfileLoop)
	for i in range(0,len(innerPts[j])-1):
		#innerProfileLoop.Append(Autodesk.Revit.DB.Line.CreateBound(XYZ(innerPts[j][i].X,innerPts[j][i].Y,innerPts[j][i].Z),XYZ(innerPts[j][i+1].X,innerPts[j][i+1].Y,innerPts[j][i+1].Z)))
		innerProfileLoop.Append(Autodesk.Revit.DB.Line.CreateBound(innerPts[i][j]))

region = FilledRegion.Create(doc,frt[0].Id,activeViewId,profileLoops)
regions.Add(region)

TransactionManager.Instance.TransactionTaskDone()

#Assign your outputs to the OUT variable
OUT = regions
# ----------------------------------------
centerPoint = Circle.CenterPoint()  # unwired: arg0
origin = Point.Origin()
code_block_3 = CodeBlock { 2500; }
code_block_4 = CodeBlock { Autodesk.Vector.ZAxis(); }
code_block_5 = CodeBlock(ctr=origin, radius=code_block_3, vector=code_block_4) { Arc.ByCenterPointRadiusAngle(ctr,radius,0,180,vector); }
origin_2 = Point.Origin()
python_script_3 = Python(IN[1]=code_block_2)  # unwired: IN[0]
# ---------- python_script_3.python (65 lines) ----------
import clr
clr.AddReference('ProtoGeometry')
from Autodesk.DesignScript.Geometry import *

# Import DocumentManager and TransactionManager
clr.AddReference("RevitServices")
import RevitServices
from RevitServices.Persistence import DocumentManager
from RevitServices.Transactions import TransactionManager

# Import RevitAPI
clr.AddReference("RevitAPI")
import Autodesk
from Autodesk.Revit.DB import *

doc = DocumentManager.Instance.CurrentDBDocument
uiapp = DocumentManager.Instance.CurrentUIApplication
app = uiapp.Application

activeViewId = doc.ActiveView.Id;


planePts = UnwrapElement(IN[0])
frt = UnwrapElement(IN[1])
ptCoord = []

for p in planePts:
	ptCoord.append(XYZ(p.X,p.Y,p.Z))

	
regions = []




profileLoops = []

halfCircle = CurveLoop()
profileLoops.Add(halfCircle)

TransactionManager.Instance.EnsureInTransaction(doc)

radius = 1000;
startAngle = 0
endAngle = 180

plane = Plane.CreateByThreePoints(ptCoord[0],ptCoord[1],ptCoord[2])
arc1 = Arc.Create(plane, radius, 0, 180)
arc2 = Arc.Create(plane, radius, 180, 360)
arc3 = Arc.Create(arc2.GetEndPoint(1),arc2.GetEndPoint(0),arc2.Evaluate(0.5,True))

halfCircle.Append(arc1)
halfCircle.Append(arc3)

"""
halfCircle.Append(arc1)
halfCircle.Append(arc2)
"""
region = FilledRegion.Create(doc,frt[0].Id,activeViewId,profileLoops)
regions.Add(region)

TransactionManager.Instance.TransactionTaskDone()

#Assign your outputs to the OUT variable
OUT = profileLoops
# ----------------------------------------
select_model_element = DSModelElementSelection()  # 1 picked in the model
curves = Element.Curves(select_model_element)
centerPoint_2 = Circle.CenterPoint(curves)
radius = Circle.Radius(curves)
code_block_6 = CodeBlock(ctr=centerPoint_2, radius=radius, vector=code_block_4) { Arc.ByCenterPointRadiusAngle(ctr,radius,180,360,vector); }
code_block_7 = CodeBlock { {0,0.99,1}; }
pointAtParameter = Curve.PointAtParameter(curve=code_block_6, param=code_block_7, lacing=Longest)
code_block_8 = CodeBlock { 0.00328083976474163150845660082324; }
scale = Geometry.Scale(geometry=pointAtParameter, amount=code_block_8)
select_model_elements = DSModelElementsSelection()  # 4 picked in the model
curves_2 = Element.Curves(select_model_elements)
flatten = Flatten(curves_2)
group_curves = Custom[Group Curves](Curves=flatten)  # This node will take any input of flat list of curves and group them into sublists containing "joinable" curves that is continous curves. They might form closed curves or open curves. Use PolyCurve.ByJoinedCurves to convert output groups of curves into single PolyCurves
endPoint = Curve.EndPoint(group_curves)
flatten_2 = Flatten(endPoint)
python_script_4 = Python(IN[0]=flatten_2)
# ---------- python_script_4.python (5 lines) ----------
list = IN[0]

list.append(list[0])

OUT = list
# ----------------------------------------
scale_2 = Geometry.Scale(geometry=python_script_4, amount=code_block_8)
python_script_5 = Python(IN[0]=scale, IN[2]=scale_2)  # unwired: IN[1]
# ---------- python_script_5.python (62 lines) ----------
import clr
clr.AddReference('ProtoGeometry')
from Autodesk.DesignScript.Geometry import *

# Import DocumentManager and TransactionManager
clr.AddReference("RevitServices")
import RevitServices
from RevitServices.Persistence import DocumentManager
from RevitServices.Transactions import TransactionManager

# Import RevitAPI
clr.AddReference("RevitAPI")
import Autodesk
from Autodesk.Revit.DB import *

doc = DocumentManager.Instance.CurrentDBDocument
uiapp = DocumentManager.Instance.CurrentUIApplication
app = uiapp.Application

activeViewId = doc.ActiveView.Id;
pt = UnwrapElement(IN[0])
frt = UnwrapElement(IN[1])
pts = UnwrapElement(IN[2])

ptCoord = []
regions = []

for p in pt:
	ptCoord.append(XYZ(p.X,p.Y,p.Z))

profileLoops = []



TransactionManager.Instance.EnsureInTransaction(doc)

outerProfileLoop = CurveLoop()
profileLoops.Add(outerProfileLoop)

halfCircle = CurveLoop()
profileLoops.Add(halfCircle)


#create filled region
for i in range(0,len(pts)-1):
	outerProfileLoop.Append(Autodesk.Revit.DB.Line.CreateBound(XYZ(pts[i].X,pts[i].Y,pts[i].Z),XYZ(pts[i+1].X,pts[i+1].Y,pts[i+1].Z)))


arc = Arc.Create(ptCoord[1],ptCoord[2],ptCoord[0])
#line = Line.CreateBound(ptCoord[2],ptCoord[0])
line = Line.CreateBound(arc.GetEndPoint(1),arc.GetEndPoint(0))

halfCircle.Append(arc)
halfCircle.Append(line)

region = FilledRegion.Create(doc,frt[0].Id,activeViewId,profileLoops)
regions.Add(region)

TransactionManager.Instance.TransactionTaskDone()

#Assign your outputs to the OUT variable
OUT = profileLoops
# ----------------------------------------
XY = Plane.XY()
python_script_6 = Python(IN[0]=scale, IN[1]=code_block_2, IN[2]=scale_2)
# ---------- python_script_6.python (54 lines) ----------
import clr
clr.AddReference('ProtoGeometry')
from Autodesk.DesignScript.Geometry import *

# Import DocumentManager and TransactionManager
clr.AddReference("RevitServices")
import RevitServices
from RevitServices.Persistence import DocumentManager
from RevitServices.Transactions import TransactionManager

# Import RevitAPI
clr.AddReference("RevitAPI")
import Autodesk
from Autodesk.Revit.DB import *

doc = DocumentManager.Instance.CurrentDBDocument
uiapp = DocumentManager.Instance.CurrentUIApplication
app = uiapp.Application

activeViewId = doc.ActiveView.Id;
pt = UnwrapElement(IN[0])
frt = UnwrapElement(IN[1])
pts = UnwrapElement(IN[2])

ptCoord = []
regions = []

for p in pt:
	ptCoord.append(XYZ(p.X,p.Y,p.Z))

profileLoops = []

outerProfileLoop = CurveLoop()
profileLoops.Add(outerProfileLoop)

halfCircle = CurveLoop()
profileLoops.Add(halfCircle)


#create filled region
for i in range(0,len(pts)-1):
	outerProfileLoop.Append(Autodesk.Revit.DB.Line.CreateBound(XYZ(pts[i].X,pts[i].Y,pts[i].Z),XYZ(pts[i+1].X,pts[i+1].Y,pts[i+1].Z)))


arc = Arc.Create(ptCoord[1],ptCoord[2],ptCoord[0])
#line = Line.CreateBound(ptCoord[2],ptCoord[0])
line = Line.CreateBound(arc.GetEndPoint(1),arc.GetEndPoint(0))

halfCircle.Append(arc)
halfCircle.Append(line)


#Assign your outputs to the OUT variable
OUT = profileLoops
# ----------------------------------------
python_script_7 = Python(IN[0]=code_block_2, IN[1]=python_script_6)
# ---------- python_script_7.python (33 lines) ----------
import clr
clr.AddReference('ProtoGeometry')
from Autodesk.DesignScript.Geometry import *

# Import DocumentManager and TransactionManager
clr.AddReference("RevitServices")
import RevitServices
from RevitServices.Persistence import DocumentManager
from RevitServices.Transactions import TransactionManager

# Import RevitAPI
clr.AddReference("RevitAPI")
import Autodesk
from Autodesk.Revit.DB import *

doc = DocumentManager.Instance.CurrentDBDocument
uiapp = DocumentManager.Instance.CurrentUIApplication
app = uiapp.Application

activeViewId = doc.ActiveView.Id;

frt = UnwrapElement(IN[0])
profileLoops = UnwrapElement(IN[1])

ptCoord = []
regions = []


region = FilledRegion.Create(doc,frt[0].Id,activeViewId,profileLoops[0])
regions.Add(region)

#Assign your outputs to the OUT variable
OUT = profileLoops
# ----------------------------------------
