# Dynamo graph Rooms.dyn (Dynamo 1.2.0.2514)

categories = Categories("Rooms")
all_elements_of_category = ElementsOfCategory(categories)
geometry = Element.Geometry(all_elements_of_category)
file_path = Filename("Rooms\Rooms%20Schedule.xlsx")
code_block = CodeBlock { "Sheet1"; }
code_block_2 = CodeBlock { 0; }
code_block_3 = CodeBlock { {"Name","Number"}; }
getParameterValueByName = Element.GetParameterValueByName(element=all_elements_of_category, parameterName=code_block_3, lacing=CrossProduct)
code_block_4 = CodeBlock { 1; }
writeToFile = Excel.WriteToFile(filePath=file_path, sheetName=code_block, startRow=code_block_2, startCol=code_block_2, data=getParameterValueByName, overWrite=code_block_4)
code_block_5 = CodeBlock { {"Name","Comments"}; }
file_path_2 = Filename("Rooms\Rooms%20Schedule.xlsx")
fromPath = FileObject(file_path_2)  # "File.FromPath"
code_block_6 = CodeBlock { "Sheet4"; }
code_block_7 = CodeBlock { 1; }
readFromFile = Excel.ReadFromFile(file=fromPath, sheetName=code_block_6, readAsStrings=code_block_7)
transpose = List.Transpose(readFromFile)
code_block_8 = CodeBlock(a=transpose) { a[1]; }
transpose_2 = List.Transpose(getParameterValueByName)
code_block_9 = CodeBlock(a=transpose_2) { a[1]; }
code_block_10 = CodeBlock(a=transpose) { a[0]; }
indexOf = IndexOf(code_block_10)  # unwired: arg1
map = List.Map(list=code_block_9, f_x=indexOf)
getItemAtIndex = List.GetItemAtIndex(list=code_block_8, index=map)
code_block_11 = CodeBlock(a=transpose) { a[2]; }
getItemAtIndex_2 = List.GetItemAtIndex(list=code_block_11, index=map)
create = List.Create(getItemAtIndex, getItemAtIndex_2)
combine = List.Combine(arg1=code_block_5, arg2=create)  # unwired: arg0
setParameterByName = Element.SetParameterByName(element=all_elements_of_category)  # unwired: parameterName, value
restOfItems = List.RestOfItems(transpose)
getItemAtIndex_3 = List.GetItemAtIndex(list=restOfItems, index=map, lacing=CrossProduct)
combine_2 = List.Combine(setParameterByName, code_block_5, getItemAtIndex_3)
