# Dynamo graph 01 Write to Excel.dyn (Dynamo 1.2.0.2514)

categories = Categories("Rooms")
all_elements_of_category = ElementsOfCategory(categories)
geometry = Element.Geometry(all_elements_of_category)
file_path = Filename("Rooms\Rooms%20Schedule.xlsx")
code_block = CodeBlock { "Sheet1"; }
code_block_2 = CodeBlock { 0; }
code_block_3 = CodeBlock { {"Name","Number","Comments"}; }
getParameterValueByName = Element.GetParameterValueByName(element=all_elements_of_category, parameterName=code_block_3, lacing=CrossProduct)
boolean = BoolSelector(true)
writeToFile = Excel.WriteToFile(filePath=file_path, sheetName=code_block, startRow=code_block_2, startCol=code_block_2, data=getParameterValueByName, overWrite=boolean)
