# Dynamo graph 02 Read from Excel.dyn (Dynamo 1.2.0.2514)

file_path = Filename("Rooms\Rooms%20Schedule.xlsx")
fromPath = FileObject(file_path)  # "File.FromPath"
code_block = CodeBlock { "Sheet4"; }
code_block_2 = CodeBlock { 1; }
readFromFile = Excel.ReadFromFile(file=fromPath, sheetName=code_block, readAsStrings=code_block_2)
transpose = List.Transpose(readFromFile)
code_block_3 = CodeBlock(a=transpose) { a[0]; }
