# Dynamo graph 04 Set Room Parameter.dyn (Dynamo 1.2.0.2514)

categories = Categories("Rooms")
all_elements_of_category = ElementsOfCategory(categories)
geometry = Element.Geometry(all_elements_of_category)
code_block = CodeBlock { "Occupancy"; }
file_path = Filename("Rooms\Rooms%20Schedule.xlsx")
fromPath = FileObject(file_path)  # "File.FromPath"
code_block_2 = CodeBlock { "Sheet4"; }
code_block_3 = CodeBlock { 1; }
readFromFile = Excel.ReadFromFile(file=fromPath, sheetName=code_block_2, readAsStrings=code_block_3)
transpose = List.Transpose(readFromFile)
code_block_4 = CodeBlock(a=transpose) { a[2]; }
code_block_5 = CodeBlock { {"Number"}; }
getParameterValueByName = Element.GetParameterValueByName(element=all_elements_of_category, parameterName=code_block_5, lacing=Longest)
code_block_6 = CodeBlock(a=transpose) { a[0]; }
indexOf = IndexOf(code_block_6)  # unwired: arg1
map = List.Map(list=getParameterValueByName, f_x=indexOf)
getItemAtIndex = List.GetItemAtIndex(list=code_block_4, index=map)
setParameterByName = Element.SetParameterByName(element=all_elements_of_category, parameterName=code_block, value=getItemAtIndex)
