# Dynamo graph 05 Set Multiple Parameters.dyn (Dynamo 1.2.0.2514)

categories = Categories("Rooms")
all_elements_of_category = ElementsOfCategory(categories)
geometry = Element.Geometry(all_elements_of_category)
setParameterByName = Element.SetParameterByName(element=all_elements_of_category)  # unwired: parameterName, value
file_path = Filename("Rooms\Rooms%20Schedule.xlsx")
fromPath = FileObject(file_path)  # "File.FromPath"
code_block = CodeBlock { "Sheet4"; }
code_block_2 = CodeBlock { 1; }
readFromFile = Excel.ReadFromFile(file=fromPath, sheetName=code_block, readAsStrings=code_block_2)
code_block_3 = CodeBlock(a=readFromFile) { a[0]; }
transpose = List.Transpose(readFromFile)
code_block_4 = CodeBlock { "Number"; }
getParameterValueByName = Element.GetParameterValueByName(element=all_elements_of_category, parameterName=code_block_4, lacing=Longest)
code_block_5 = CodeBlock(a=transpose) { a[0]; }
indexOf = IndexOf(code_block_5)  # unwired: arg1
map = List.Map(list=getParameterValueByName, f_x=indexOf)
getItemAtIndex = List.GetItemAtIndex(list=transpose, index=map, lacing=CrossProduct)
combine = List.Combine(setParameterByName, code_block_3, getItemAtIndex)
