# Dynamo graph RotateElements_v08.dyn (Dynamo 0.8.2.2392)

select_model_elements = DSModelElementsSelection()  # 7 picked in the model
id = Element.Id(select_model_elements)
location = FamilyInstance.Location(select_model_elements)
code_block = CodeBlock { 0.5; }
pointAtParameter = Curve.PointAtParameter(curve=location, param=code_block)
code_block_2 = CodeBlock(a=pointAtParameter) { a.X; a.Y; a.Z+10; Autodesk.Point.ByCoordinates(a.X,a.Y,a.Z+10); }
byStartPointEndPoint = Line.ByStartPointEndPoint(startPoint=pointAtParameter, endPoint=code_block_2.out3)
code_block_3 = CodeBlock { 1.38; }
degreesToRadians = Math.DegreesToRadians(code_block_3)
count = List.Count(select_model_elements)
cycle = List.Cycle(list=degreesToRadians, amount=count)
rotate_family = Custom[Rotate Family](ElementId=id, Axis=byStartPointEndPoint, Angle=cycle)  # This node will rotate a family in Revit around a given axis by supplied angle (in radians). Please remember that every time you run your definition it will rotate family by given angle every time.
select_model_element = DSModelElementSelection()  # 1 picked in the model
