# Dynamo graph SA.dyn (Dynamo 0.8.2.2392)

file_path = Filename("H:\Project Store\QTO General\Geometry Selection\Geometry Selection\Test\SArea.xlsx")
string = StringInput("Sheet1")
number = DoubleInput(0)
number_2 = DoubleInput(0)
select_faces = SelectFaces()  # 4 picked in the model
area = Surface.Area(select_faces)
convert_between_units = DynamoConvert(area, conversionMetric=Area, conversionFrom=SquareMillimeter, conversionTo=SquareMeter)
writeToFile = Excel.WriteToFile(filePath=file_path, sheetName=string, startRow=number, startCol=number_2, data=convert_between_units)
