# Dynamo graph 1-Section01.dyn (Dynamo 1.3.2.2480)

select_model_element = DSModelElementSelection()  # 1 picked in the model
localCoordinateSystem = Custom[Element.LocalCoordinateSystem](element=select_model_element)  # Get the insertion point and local axes of an element.
code_block = CodeBlock { 0; }
code_block_2 = CodeBlock { 50; }
code_block_3 = CodeBlock { "Section Bb"; }
create_element_view = Custom[Create Element View](Xvector=localCoordinateSystem.Xvector, Yvector=localCoordinateSystem.Zvector, CropRegionOffset=code_block, ViewDepth=code_block_2, CSPoint=localCoordinateSystem.InsertionPoint, RevitElements=select_model_element, Viewname=code_block_3)  # frozen; This node makes it possible to automatically create aligned section views on selected elements. Necessary inputs are: Revit Elements: this to detect the solid.centroid. The views are oriented to that point. X-vectors and Y-vectors to get the direction of the section plane. Traditionally these vectors are taken from the location lines of linear objects or facing directions of generic elements (i.e. doors). You might replace this with the vector of a selected edge for instance.
center = Polygon.Center()  # unwired: arg0
byBoundingBox = SectionView.ByBoundingBox()  # unwired: arg0
views = Views()
familyType = Custom[FamilyInstance.FamilyType](FamilyInstance=views)  # This node will return a Family Type of a given Family Instance. If no Family Type can be assigned to a Family then it will return Null.
python_script = Python(IN[0]=views)
# ---------- python_script.python (63 lines) ----------
# Copyright(c) 2016, Konrad K Sobon
# @arch_laboratory, http://archi-lab.net

# Import Element wrapper extension methods
import clr
clr.AddReference("RevitNodes")
import Revit
clr.ImportExtensions(Revit.Elements)

# Import DocumentManager and TransactionManager
clr.AddReference("RevitServices")
import RevitServices
from RevitServices.Persistence import DocumentManager
from RevitServices.Transactions import TransactionManager
doc = DocumentManager.Instance.CurrentDBDocument

# Import RevitAPI
clr.AddReference("RevitAPI")
import Autodesk
from Autodesk.Revit.DB import *

import sys
pyt_path = r'C:\Program Files (x86)\IronPython 2.7\Lib'
sys.path.append(pyt_path)

#The inputs to this node will be stored as a list in the IN variable.
dataEnteringNode = IN

def Unwrap(item):
	return UnwrapElement(item)

def ProcessList(_func, _list):
    return map( lambda x: ProcessList(_func, x) if type(x)==list else _func(x), _list )

def GetFamilyType(famInst):
	try:
		id = famInst.GetTypeId()
		if id == ElementId.InvalidElementId:
			return None
		else:
			return doc.GetElement(id)
	except:
		return None
		pass

if isinstance(IN[0], list):
	elements = ProcessList(Unwrap, IN[0])
else:
	elements = [Unwrap(IN[0])]

try:
	errorReport = None
	output = ProcessList(GetFamilyType, elements)
except:
	# if error accurs anywhere in the process catch it
	import traceback
	errorReport = traceback.format_exc()

#Assign your output to the OUT variable
if errorReport == None:
	OUT = output
else:
	OUT = errorReport
# ----------------------------------------
boundingBox = Element.BoundingBox(select_model_element)
properties = Custom[BoundingBox.Properties](boundingBox=boundingBox)  # Retrieves the centroid, width, depth and height of a given bounding box
python_script_2 = Python(IN[1]=python_script, IN[2]=properties.Centroid)  # unwired: IN[0]
# ---------- python_script_2.python (64 lines) ----------
import clr
clr.AddReference("ProtoGeometry")
from Autodesk.DesignScript.Geometry import *
# Import RevitAPI
clr.AddReference("RevitAPI")
from Autodesk.Revit.DB import *
clr.AddReference("RevitAPIUI")
from Autodesk.Revit.UI import TaskDialog
# Import DocumentManager and TransactionManager
clr.AddReference("RevitServices")
from RevitServices.Persistence import DocumentManager
from RevitServices.Transactions import TransactionManager
# Import ToProtoType, ToRevitType geometry conversion extension methods
clr.AddReference("RevitNodes")
import Revit
clr.ImportExtensions(Revit.GeometryConversion)

doc = DocumentManager.Instance.CurrentDBDocument
uiapp = DocumentManager.Instance.CurrentUIApplication
app = uiapp.Application


ebbox = UnwrapElement(IN[0])

viewFamily = UnwrapElement(IN[1])

convBoxMax = ebbox.MaxPoint.ToXyz()
convBoxMin = ebbox.MinPoint.ToXyz()

w = (convBoxMax.X - convBoxMin.X)
d = (convBoxMax.Y - convBoxMin.Y)
h = (convBoxMax.Z - convBoxMin.Z)

maxPt = XYZ(-w, h, d)
minPt = XYZ(w, -h, -d)
  
bbox = BoundingBoxXYZ()

bbox.Enabled = True
bbox.Max = maxPt
bbox.Min = minPt

trans = Transform.Identity

midPt = UnwrapElement(IN[2]).ToXyz()

trans.Origin = midPt
 
 
trans.BasisX = -XYZ.BasisX
trans.BasisY = XYZ.BasisZ
trans.BasisZ = XYZ.BasisY
 
bbox.Transform = trans

TransactionManager.Instance.EnsureInTransaction(doc)

viewSection = ViewSection.CreateSection(doc, viewFamily[0].Id, bbox)


TransactionManager.Instance.TransactionTaskDone()


OUT = convBoxMin, convBoxMax, maxPt, minPt, viewSection
# ----------------------------------------
create_element_view_2 = Custom[Create Element View]()  # unwired: Xvector, Yvector, CropRegionOffset, ViewDepth, CSPoint, RevitElements, Viewname
python_script_3 = Python(IN[1]=python_script, IN[2]=properties.Centroid)  # unwired: IN[0]
# ---------- python_script_3.python (64 lines) ----------
import clr
clr.AddReference("ProtoGeometry")
from Autodesk.DesignScript.Geometry import *
# Import RevitAPI
clr.AddReference("RevitAPI")
from Autodesk.Revit.DB import *
clr.AddReference("RevitAPIUI")
from Autodesk.Revit.UI import TaskDialog
# Import DocumentManager and TransactionManager
clr.AddReference("RevitServices")
from RevitServices.Persistence import DocumentManager
from RevitServices.Transactions import TransactionManager
# Import ToProtoType, ToRevitType geometry conversion extension methods
clr.AddReference("RevitNodes")
import Revit
clr.ImportExtensions(Revit.GeometryConversion)

doc = DocumentManager.Instance.CurrentDBDocument
uiapp = DocumentManager.Instance.CurrentUIApplication
app = uiapp.Application


ebbox = UnwrapElement(IN[0])

viewFamily = UnwrapElement(IN[1])

convBoxMax = ebbox.MaxPoint.ToXyz()
convBoxMin = ebbox.MinPoint.ToXyz()

w = (convBoxMax.X - convBoxMin.X)
d = (convBoxMax.Y - convBoxMin.Y)
h = (convBoxMax.Z - convBoxMin.Z)

maxPt = XYZ(w, h, 0.0)
minPt = XYZ(-w, -h, -d)
  
bbox = BoundingBoxXYZ()

bbox.Enabled = True
bbox.Max = maxPt
bbox.Min = minPt

trans = Transform.Identity

midPt = UnwrapElement(IN[2]).ToXyz()

trans.Origin = midPt
 
 
trans.BasisX = XYZ.BasisX
trans.BasisY = XYZ.BasisZ
trans.BasisZ = -XYZ.BasisY
 
bbox.Transform = trans

TransactionManager.Instance.EnsureInTransaction(doc)

viewSection = ViewSection.CreateSection(doc, viewFamily[0].Id, bbox)


TransactionManager.Instance.TransactionTaskDone()


OUT = w,d,h, viewSection
# ----------------------------------------
# note: As Point.X and Point.Y only work according to global WCS, the curves are transformed from the solid.centroid to the WCS in order to define the MinPoint and MaxPoint of the cut surface (offset values already included)
code_block_4 = CodeBlock(a=python_script_3) { a[3]; }
code_block_5 = CodeBlock {  }
setCropBoxCurves = Custom[View.SetCropBoxCurves]()  # Input views and lists of curves to set the view crop regions; unwired: Views, Curves
views_2 = Views("(4)CC23 Section")
code_block_6 = CodeBlock { {500,-500}; }
code_block_7 = CodeBlock { {-5000,10000}; }
translate = Geometry.Translate(geometry=localCoordinateSystem.InsertionPoint, yTranslation=code_block_6, zTranslation=code_block_7, lacing=CrossProduct)
flatten = Flatten(translate)
code_block_8 = CodeBlock(a=flatten) { {a[0],a[1],a[3],a[2]}; }
code_block_9 = CodeBlock { 1; }
byPoints = PolyCurve.ByPoints(points=code_block_8, connectLastToFirst=code_block_9)
explode = Geometry.Explode(byPoints)
views_3 = Views("Section Bb")
byCurve = Custom[DetailCurve.ByCurve+](curve=explode, view=views_3)  # Creates a detail line based on a given curve. Unlike the OOTB node it can also draw circles.
select_model_element_2 = DSModelElementSelection()  # 1 picked in the model
select_model_element_3 = DSModelElementSelection()  # 1 picked in the model
views_4 = Views("(4)PC19 Section")
views_5 = Views("(4)PC78 Section")
getCropBoxCurves = Custom[View.GetCropBoxCurves](Views=views_5)  # returns the curves of a view crop box, even irregular shapes. Returns an empty list if the crop view is not active for a given view
python_script_4 = Python(IN[0]=views_4, IN[1]=getCropBoxCurves)
# ---------- python_script_4.python (61 lines) ----------
import clr
clr.AddReference('ProtoGeometry')
from Autodesk.DesignScript.Geometry import *

import clr
clr.AddReference('RevitAPI')
import Autodesk.Revit.DB

import clr
clr.AddReference("RevitNodes")
import Revit

clr.AddReference('DSCoreNodes')
import DSCore
from DSCore import *

clr.AddReference("RevitServices")
import RevitServices
from RevitServices.Persistence import DocumentManager
from RevitServices.Transactions import TransactionManager
doc = DocumentManager.Instance.CurrentDBDocument

# Import ToProtoType, ToRevitType geometry conversion extension methods
clr.ImportExtensions(Revit.GeometryConversion)

#The inputs to this node will be stored as a list in the IN variables.
if isinstance(IN[0], list):
	views = UnwrapElement(IN[0])
else:
	views = [UnwrapElement(IN[0])]
if isinstance(IN[1], list):
	if IN[1][0].GetType() == PolyCurve:
		curves = [PolyCurve.Curves(x) for x in IN[1]]
	elif IN[1][0].GetType() == Curve or IN[1][0].GetType() == Line:
		curves = List.OfRepeatedItem(IN[1],len(views))
	else:
		curves = IN[1]
else:
	if IN[1].GetType() == PolyCurve:
		curves = [PolyCurve.Curves(IN[1])]
	else:
		curves = [IN[1]]
	
listout = []
for view,curve in zip(views,curves):
	regionMan = view.GetCropRegionShapeManager()
	revit_curve = [c.ToRevitType() for c in curve]
	curveloop = Autodesk.Revit.DB.CurveLoop()
	for c in revit_curve:
		curveloop.Append(c)
	TransactionManager.Instance.EnsureInTransaction(doc)
	if view.CropBoxActive == False:
		view.CropBoxActive = True
		view.CropBoxVisible = True
	regionMan.SetCropShape(curveloop)
	TransactionManager.Instance.TransactionTaskDone()
	listout.append(view)


#Assign your output to the OUT variable.
OUT = listout
# ----------------------------------------
select_model_elements = DSModelElementsSelection()  # 4 picked in the model
curves = Element.Curves(select_model_elements)
flatten_2 = Flatten(curves)
