# Dynamo graph AlignSection.dyn (Dynamo 1.3.1.1736)

select_model_element = DSModelElementSelection()  # 1 picked in the model
name = Element.Name(select_model_element)
views = Views("Section 4")
boundingBox = Geometry.BoundingBox(views)
select_model_element_2 = DSModelElementSelection()  # 1 picked in the model
python_script = Python(IN[0]=select_model_element_2)
# ---------- python_script.python (35 lines) ----------
import clr

clr.AddReference("RevitServices")
import RevitServices
from RevitServices.Persistence import DocumentManager
from RevitServices.Transactions import TransactionManager
doc = DocumentManager.Instance.CurrentDBDocument

clr.AddReference("RevitAPI")
import Autodesk
from Autodesk.Revit.DB import *

clr.AddReference("RevitNodes")
import Revit
clr.ImportExtensions(Revit.Elements)
clr.ImportExtensions(Revit.GeometryConversion)

clr.AddReference("System")
from System.Collections.Generic import List

section = UnwrapElement(IN[0])

secOrigin = section.Location



TransactionManager.Instance.EnsureInTransaction(doc)
	#pipe = Autodesk.Revit.DB.Plumbing.Pipe.Create(doc,systemtype.Id,pipetype.Id,level[0].Id,FirstPoint[i].ToXyz(),SecondPoint[i].ToXyz())

	
#elements.append(pipe.ToDSType(False))

TransactionManager.Instance.TransactionTaskDone()

OUT = secOrigin
# ----------------------------------------
python_script_2 = Python(IN[0]=views)
# ---------- python_script_2.python (37 lines) ----------
import clr

clr.AddReference("RevitServices")
import RevitServices
from RevitServices.Persistence import DocumentManager
from RevitServices.Transactions import TransactionManager
doc = DocumentManager.Instance.CurrentDBDocument

clr.AddReference("RevitAPI")
import Autodesk
from Autodesk.Revit.DB import *

clr.AddReference("RevitNodes")
import Revit
clr.ImportExtensions(Revit.Elements)
clr.ImportExtensions(Revit.GeometryConversion)

clr.AddReference("System")
from System.Collections.Generic import List

section = UnwrapElement(IN[0])

secOrigin = section.Origin

revitPoint = section.Origin.ToPoint()

vectorPoint = section.Origin.ToVector()

TransactionManager.Instance.EnsureInTransaction(doc)
	#pipe = Autodesk.Revit.DB.Plumbing.Pipe.Create(doc,systemtype.Id,pipetype.Id,level[0].Id,FirstPoint[i].ToXyz(),SecondPoint[i].ToXyz())

	
#elements.append(pipe.ToDSType(False))

TransactionManager.Instance.TransactionTaskDone()

OUT = revitPoint, section.Origin.BasisZ, secOrigin, vectorPoint
# ----------------------------------------
code_block = CodeBlock(a=python_script_2) { a[0]; }
code_block_2 = CodeBlock(a=python_script_2) { a[2]; }
python_script_3 = Python(IN[0]=code_block_2)
# ---------- python_script_3.python (28 lines) ----------
import clr

clr.AddReference("ProtoGeometry")
from Autodesk.DesignScript.Geometry import *

clr.AddReference("RevitServices")
import RevitServices
from RevitServices.Persistence import DocumentManager
from RevitServices.Transactions import TransactionManager
doc = DocumentManager.Instance.CurrentDBDocument

clr.AddReference("RevitAPI")
import Autodesk
from Autodesk.Revit.DB import *

clr.AddReference("RevitNodes")
import Revit
clr.ImportExtensions(Revit.Elements)
clr.ImportExtensions(Revit.GeometryConversion)

clr.AddReference("System")
from System.Collections.Generic import List

pt = IN[0]



OUT = Autodesk.DesignScript.Geometry.Point.ByCoordinates(pt.X,pt.Y,pt.Z)
# ----------------------------------------
code_block_3 = CodeBlock { 5000; }
code_block_4 = CodeBlock(a=views) { {a}; }
python_script_4 = Python(IN[0]=code_block_4)
# ---------- python_script_4.python (19 lines) ----------
import clr
clr.AddReference('RevitAPI')
from Autodesk.Revit.DB import *

clr.AddReference("RevitNodes")
import Revit
clr.ImportExtensions(Revit.GeometryConversion)

items = UnwrapElement(IN[0])
dlist = list()
orig = []

for item in items:
	try:
		dlist.append(item.ViewDirection.ToVector())
		orig.append(item.Origin.ToPoint())
	except:
		dlist.append(None)
OUT = dlist, orig
# ----------------------------------------
code_block_5 = CodeBlock(a=python_script_4) { a[1]; }
getLocation = Element.GetLocation(select_model_element_2)
code_block_6 = CodeBlock { {0,1}; }
pointAtParameter = Curve.PointAtParameter(curve=getLocation, param=code_block_6)
byTwoPoints = Vector.ByTwoPoints(start=code_block_5, end=pointAtParameter, lacing=Longest)
length = Vector.Length(byTwoPoints)
minimumItem = List.MinimumItem(length)
indexOf = IndexOf(length, minimumItem)
getItemAtIndex = List.GetItemAtIndex(list=byTwoPoints, index=indexOf)
byStartPointDirectionLength = Line.ByStartPointDirectionLength(startPoint=code_block_5, direction=getItemAtIndex, length=minimumItem)
byCurve = ModelCurve.ByCurve(byStartPointDirectionLength)
code_block_7 = CodeBlock(a=python_script_2) { a[3]; }
closestPointTo = Geometry.ClosestPointTo()  # unwired: geometry, other
translate = Geometry.Translate(geometry=byStartPointDirectionLength, direction=getItemAtIndex, distance=minimumItem)
code_block_8 = CodeBlock(a=python_script_4) { a[0]; }
ZAxis = Vector.ZAxis()
code_block_9 = CodeBlock { 90; }
rotate = Vector.Rotate(code_block_8, ZAxis, code_block_9)
code_block_10 = CodeBlock { 5000; }
byStartPointDirectionLength_2 = Line.ByStartPointDirectionLength(startPoint=code_block_5, direction=rotate, length=code_block_10)
byCurve_2 = ModelCurve.ByCurve(byStartPointDirectionLength_2)
python_script_5 = Python(IN[0]=views, IN[1]=getItemAtIndex, IN[2]=code_block_5)
# ---------- python_script_5.python (29 lines) ----------
import clr
clr.AddReference('RevitAPI')
from Autodesk.Revit.DB import *

import clr
clr.AddReference("RevitServices")
from RevitServices.Persistence import DocumentManager
from RevitServices.Transactions import TransactionManager

clr.AddReference("RevitNodes")
import Revit
clr.ImportExtensions(Revit.GeometryConversion)

doc = DocumentManager.Instance.CurrentDBDocument

section = UnwrapElement(IN[0])

transaction = UnwrapElement(IN[1]).ToXyz()

TransactionManager.Instance.EnsureInTransaction(doc)

ElementTransformUtils.MoveElement(doc, section.Id, transaction)

TransactionManager.Instance.TransactionTaskDone



		
OUT = section
# ----------------------------------------
