# Dynamo graph AlignSection01.dyn (Dynamo 1.3.1.1736)

select_model_element = DSModelElementSelection()  # 1 picked in the model
name = Element.Name(select_model_element)
code_block = CodeBlock { 5000; }
views = Views("Section 4")
code_block_2 = CodeBlock(a=views) { {a}; }
python_script = Python(IN[0]=code_block_2)
# ---------- python_script.python (19 lines) ----------
import clr
clr.AddReference('RevitAPI')
from Autodesk.Revit.DB import *

clr.AddReference("RevitNodes")
import Revit
clr.ImportExtensions(Revit.GeometryConversion)

items = UnwrapElement(IN[0])
dlist = list()
orig = []

for item in items:
	try:
		dlist.append(item.ViewDirection.ToVector())
		orig.append(item.Origin.ToPoint())
	except:
		dlist.append(None)
OUT = dlist, orig
# ----------------------------------------
code_block_3 = CodeBlock(a=python_script) { a[0]; }
ZAxis = Vector.ZAxis()
code_block_4 = CodeBlock { 90; }
rotate = Vector.Rotate(code_block_3, ZAxis, code_block_4)
code_block_5 = CodeBlock(a=python_script) { a[1]; }
code_block_6 = CodeBlock(a=code_block_5) { a[0]; }
select_model_element_2 = DSModelElementSelection()  # 1 picked in the model
getLocation = Element.GetLocation(select_model_element_2)
code_block_7 = CodeBlock { {0,1}; }
pointAtParameter = Curve.PointAtParameter(curve=getLocation, param=code_block_7)
byTwoPoints = Vector.ByTwoPoints(start=code_block_5, end=pointAtParameter, lacing=Longest)
length = Vector.Length(byTwoPoints)
minimumItem = List.MinimumItem(length)
indexOf = IndexOf(length, minimumItem)
getItemAtIndex = List.GetItemAtIndex(list=pointAtParameter, index=indexOf)
python_script_2 = Python(IN[1]=code_block_6, IN[2]=getItemAtIndex)  # unwired: IN[0]
# ---------- python_script_2.python (29 lines) ----------
import clr
clr.AddReference('RevitAPI')
from Autodesk.Revit.DB import *

import clr
clr.AddReference("RevitServices")
from RevitServices.Persistence import DocumentManager
from RevitServices.Transactions import TransactionManager

clr.AddReference("RevitNodes")
import Revit
clr.ImportExtensions(Revit.GeometryConversion)

doc = DocumentManager.Instance.CurrentDBDocument

section = UnwrapElement(IN[0])

transaction = UnwrapElement(IN[2]).ToXyz()-UnwrapElement(IN[1]).ToXyz()

TransactionManager.Instance.EnsureInTransaction(doc)

ElementTransformUtils.MoveElement(doc, section.Id, transaction)

TransactionManager.Instance.TransactionTaskDone



		
OUT = section,transaction
# ----------------------------------------
code_block_8 = CodeBlock(a=select_model_element) { a; }
byTwoPoints_2 = Vector.ByTwoPoints(start=code_block_5, end=getItemAtIndex)
code_block_9 = CodeBlock(a=byTwoPoints_2) { a[0]; }
python_script_3 = Python(IN[0]=code_block_8, IN[1]=code_block_9)
# ---------- python_script_3.python (30 lines) ----------
import clr
clr.AddReference('RevitAPI')
from Autodesk.Revit.DB import *

import clr
clr.AddReference("RevitServices")
from RevitServices.Persistence import DocumentManager
from RevitServices.Transactions import TransactionManager

clr.AddReference("RevitNodes")
import Revit
clr.ImportExtensions(Revit.GeometryConversion)

doc = DocumentManager.Instance.CurrentDBDocument

section = UnwrapElement(IN[0])

newloc = IN[1].ToXyz(True)

TransactionManager.Instance.EnsureInTransaction(doc)

ElementTransformUtils.MoveElement(doc,section.Id,newloc)

TransactionManager.Instance.TransactionTaskDone()




		
OUT = section,newloc
# ----------------------------------------
python_script_4 = Python()  # unwired: IN[0], IN[1]
# ---------- python_script_4.python (31 lines) ----------
import clr

clr.AddReference("RevitServices")
import RevitServices
from RevitServices.Persistence import DocumentManager
from RevitServices.Transactions import TransactionManager
doc =  DocumentManager.Instance.CurrentDBDocument

clr.AddReference("RevitNodes")
import Revit
clr.ImportExtensions(Revit.Elements)
clr.ImportExtensions(Revit.GeometryConversion)

clr.AddReference("RevitAPI")
from Autodesk.Revit.DB import ElementTransformUtils, ElementId

clr.AddReference("System")
from System.Collections.Generic import List


els = UnwrapElement(IN[0])
Ids = List[ElementId]()
for e in els:
	Ids.Add(e.Id)
newloc = IN[1].ToXyz(True)

TransactionManager.Instance.EnsureInTransaction(doc)
ElementTransformUtils.MoveElements(doc,Ids,newloc)
TransactionManager.Instance.TransactionTaskDone()

OUT = els
# ----------------------------------------
