# Dynamo graph Home (2).dyn (Dynamo 0.9.1.4062)

code_block = CodeBlock { 0; }
getItemAtIndex = List.GetItemAtIndex(index=code_block)
map = List.Map(f_x=getItemAtIndex)
key_schedule = Custom[Key Schedule]()  # This node will take a key schedule, data and a list of parameters and populate it with infomation from data parameter. Visit www.archi-lab.net for more information on how to prep this node for take off.
code_block_2 = CodeBlock { {"Key Name","test1","test2","test3","test4"}; }
get_all_views = Custom[Get All Views]()  # This node will query all views in the model and return them based on category
code_block_3 = CodeBlock(view=get_all_views.Schedules) { view[0]; }
name = Element.Name(code_block_3)
file_path = Filename("C:\Users\giovanni.brogioli\Desktop\Test.xlsx")
fromPath = FileObject(file_path)  # "File.FromPath"
code_block_4 = CodeBlock { "BEAM"; }
readFromFile = Excel.ReadFromFile(file=fromPath, sheetName=code_block_4)
input = CodeBlock { {"Key Name","test1","test2","test3","test4"}; }
python_script = Python(IN[0]=code_block_3, IN[1]=readFromFile, IN[2]=input)
# ---------- python_script.python (69 lines) ----------
#Copyright(c) 2015, Konrad Sobon
# @arch_laboratory, http://archi-lab.net

import clr
clr.AddReference('ProtoGeometry')
from Autodesk.DesignScript.Geometry import *

# Import DocumentManager and TransactionManager
clr.AddReference("RevitServices")
import RevitServices
from RevitServices.Persistence import DocumentManager
from RevitServices.Transactions import TransactionManager

# Import RevitAPI
clr.AddReference("RevitAPI")
import Autodesk
from Autodesk.Revit.DB import *

doc = DocumentManager.Instance.CurrentDBDocument
uiapp = DocumentManager.Instance.CurrentUIApplication
app = uiapp.Application

from System.Collections.Generic import *

# Import ToDSType(bool) extension method
clr.AddReference("RevitNodes")
import Revit
clr.ImportExtensions(Revit.Elements)

#The inputs to this node will be stored as a list in the IN variable.
dataEnteringNode = IN

keySchedule = UnwrapElement(IN[0])
data = IN[1]
inputParams = IN[2]

# "Start" the transaction
TransactionManager.Instance.EnsureInTransaction(doc)

test = []
count = []
cellParams = [[] for i in range(len(data))]
if any(isinstance(item, list) for item in data):
	# process list of lists
	for i in data:
		count.append(len(i))
	colCount = max(count)
	colAvailable = len(keySchedule.Definition.GetSchedulableFields())
	if colCount > colAvailable:
		message = "Please add/remove parameters to/from schedule so that they match longest data set."
	else:
		tableData = keySchedule.GetTableData()
		sectionData = tableData.GetSectionData(SectionType.Body)
		if sectionData.NumberOfRows - 2 <= len(data):
			# schedule by default will have 2 rows (A, B, C and Header Names)
			rowsToAdd = (len(data) - sectionData.NumberOfRows) + 2
			for i in range(0, rowsToAdd, 1):
				sectionData.InsertRow(0)
		else:
			# schedule when updating might already have too many rows 
			rowsToDelete = sectionData.NumberOfRows - 2 - len(data)
			for i in reversed(range(sectionData.NumberOfRows - rowsToDelete, sectionData.NumberOfRows, 1)):
				sectionData.RemoveRow(i)

# "End" the transaction
TransactionManager.Instance.TransactionTaskDone()

#Assign your output to the OUT variable
OUT = keySchedule
# ----------------------------------------
input_2 = CodeBlock { UpperCase:bool = false; }
python_script_2 = Python(IN[0]=python_script, IN[1]=readFromFile, IN[2]=input, IN[3]=input_2)
# ---------- python_script_2.python (85 lines) ----------
#Copyright(c) 2015, Konrad Sobon
# @arch_laboratory, http://archi-lab.net

import clr
import sys
clr.AddReference('ProtoGeometry')
from Autodesk.DesignScript.Geometry import *

# Import DocumentManager and TransactionManager
clr.AddReference("RevitServices")
import RevitServices
from RevitServices.Persistence import DocumentManager
from RevitServices.Transactions import TransactionManager

# Import RevitAPI
clr.AddReference("RevitAPI")
import Autodesk
from Autodesk.Revit.DB import *

doc = DocumentManager.Instance.CurrentDBDocument
uiapp = DocumentManager.Instance.CurrentUIApplication
app = uiapp.Application

from System.Collections.Generic import *

# Import ToDSType(bool) extension method
clr.AddReference("RevitNodes")
import Revit
clr.ImportExtensions(Revit.Elements)

pyt_path = r'C:\Program Files (x86)\IronPython 2.7\Lib'
sys.path.append(pyt_path)
import re

#The inputs to this node will be stored as a list in the IN variable.
dataEnteringNode = IN

keySchedule = UnwrapElement(IN[0])
data = IN[1]
inputParams = IN[2]
upper = IN[3]

# "Start" the transaction
TransactionManager.Instance.EnsureInTransaction(doc)

tableData = keySchedule.GetTableData()
sectionData = tableData.GetSectionData(SectionType.Body)

keyNames = []
for i in range(1,sectionData.NumberOfRows - 1,1):
	keyNames.append(str(int(i)))

allKeys = FilteredElementCollector(doc).WhereElementIsNotElementType()
params = [[] for i in range(len(keyNames))]
test = []
for key in allKeys:
	try:
		if key.get_Parameter(BuiltInParameter.REF_TABLE_ELEM_NAME).AsString() in keyNames and key.OwnerViewId == keySchedule.Id:
			indexValue = keyNames.index(key.get_Parameter(BuiltInParameter.REF_TABLE_ELEM_NAME).AsString())
			for i in range(0, len(inputParams),1):
				params[indexValue].extend(key.GetParameters(str(inputParams[i])))
	except:
		pass

for i, j in zip(params, data):
	for param, value in zip(i,j):
		if isinstance(value, str):
			valueDecoded = value.decode('string_escape')
		else:
			if value == None:
				valueDecoded = " "
			else:
				valueDecoded = str(value).decode('string_escape')
		if upper:
			valueDecoded = valueDecoded.upper()
			param.Set(valueDecoded)
		else:
			param.Set(valueDecoded)


# "End" the transaction
TransactionManager.Instance.TransactionTaskDone()

#Assign your output to the OUT variable
OUT = keySchedule
# ----------------------------------------
output = CodeBlock(ViewSchedule=python_script_2) { ViewSchedule; }
input_3 = CodeBlock { ViewSchedule; }
