# Dynamo graph framing.dyn (Dynamo 0.9.1.4062)

family_types = FamilyTypes()
family_types_2 = FamilyTypes("Circular Mullion:Circular Mullion 1")
parameters = Element.Parameters(family_types_2)
code_block = CodeBlock { 13; }
getItemAtIndex = List.GetItemAtIndex(list=parameters, index=code_block)
name = Parameter.Name(getItemAtIndex)
input = CodeBlock { 0; }
all_elements_of_family_type = ElementsOfFamilyType(family_types_2)
select_model_elements = DSModelElementsSelection()  # 8 picked in the model
geometry = Element.Geometry(select_model_elements)
flatten = Flatten(geometry)
levels = Levels("Level 1")
family_types_3 = FamilyTypes("STR_Plate Girder:orignal")
file_path = Filename("J:\200000\232600\232693 - Project Newfoundland\4 Internal Data\03 Drawings\07 Structural\232693 families\STR_Plate Girder.xlsx")
fromPath = FileObject(file_path)  # "File.FromPath"
code_block_2 = CodeBlock { "STR_Plate Girder"; }
readFromFile = Excel.ReadFromFile(file=fromPath, sheetName=code_block_2)
code_block_3 = CodeBlock { 0; }
getItemAtIndex_2 = List.GetItemAtIndex(index=code_block_3)
map = List.Map(list=readFromFile, f_x=getItemAtIndex_2)
duplicate = Custom[FamilyType.Duplicate](family_type=family_types_3, name_s=map)  # Create duplicate family types with the specified name. If the type exists, it is called.
beamByCurve = StructuralFraming.BeamByCurve(curve=flatten, level=levels, structuralFramingType=duplicate)
code_block_4 = CodeBlock { " }
family_types_4 = FamilyTypes()
type = Custom[Element.Type](element=family_types_4)  # Gets the family type of a given element (if applicable).
parameters_2 = Element.Parameters()
code_block_5 = CodeBlock { 9; }
getItemAtIndex_3 = List.GetItemAtIndex(list=parameters_2, index=code_block_5)
byFamilyType = FamilyInstance.ByFamilyType()
select_model_element = DSModelElementSelection()
type_2 = Custom[Element.Type](element=select_model_element)
family_types_5 = FamilyTypes()
get_family_parameter = FamilyInstanceParameters(family_types_5)
code_block_6 = CodeBlock { 100; }
setMultipleParametersByName = Custom[Element.SetMultipleParametersByName](element=type_2, parameterName=get_family_parameter, value=code_block_6)  # Set multiple (comma seperated) parameters by name.
set_type_parameter = Custom[Set Type Parameter]()  # This node will set a type parameter for an element.
code_block_7 = CodeBlock { "tw"; }
categories = Categories("StructuralFraming")
all_elements_of_category = ElementsOfCategory(categories)
get_built_in_parameter = Custom[Get Built In Parameter](ParameterNames=code_block_7, Elements=all_elements_of_category)  # This node will take an input of a built in parameter name and element to return that parameters value.
get_type_parameter = Custom[Get Type Parameter]()  # This node will retrieve a type parameter by its name.
get_built_in_parameter_2 = Custom[Get Built In Parameter](Elements=all_elements_of_category)
get_built_in_parameter_3 = Custom[Get Built In Parameter]()
get_builtinparameter_name = ItemSelector(family_types_4)
get_type_parameter_2 = Custom[Get Type Parameter](element=all_elements_of_category, parameterName=code_block_7)
parameter_types = ParameterTypeUI("Acceleration")
categories_2 = Categories("StructuralFraming")
all_elements_of_category_2 = ElementsOfCategory(categories_2)
code_block_8 = CodeBlock { "tfb"; }
setParameterByName = Element.SetParameterByName(element=select_model_element, parameterName=code_block_8, value=code_block_6)
getParameterValueByName = Element.GetParameterValueByName(element=select_model_element, parameterName=get_family_parameter)
code_block_9 = CodeBlock { "Structural Material"; }
code_block_10 = CodeBlock { "tfb"; }
file_path_2 = Filename("J:\200000\232600\232693 - Project Newfoundland\4 Internal Data\03 Drawings\07 Structural\232693 families\STR_Plate Girder.xlsx")
fromPath_2 = FileObject(file_path_2)  # "File.FromPath"
code_block_11 = CodeBlock { "STR_Plate Girder"; }
readFromFile_2 = Excel.ReadFromFile(file=fromPath_2, sheetName=code_block_11)
code_block_12 = CodeBlock { 3; }
getItemAtIndex_4 = List.GetItemAtIndex(index=code_block_12)
map_2 = List.Map(list=readFromFile_2, f_x=getItemAtIndex_4)
setParameterByName_2 = Element.SetParameterByName(element=duplicate, parameterName=code_block_10, value=map_2)
family_types_6 = FamilyTypes()
watch = Watch(family_types_6)
parameters_3 = Element.Parameters(watch)
