# Dynamo graph rotate section.dyn (Dynamo 1.0.0.1180)

select_model_element = DSModelElementSelection()
curves = Element.Curves(select_model_element)
startPoint = Curve.StartPoint(curves)
endPoint = Curve.EndPoint(curves)
byTwoPoints = Vector.ByTwoPoints(start=startPoint, end=endPoint)
select_model_element_2 = DSModelElementSelection()
curves_2 = Element.Curves(select_model_element_2)
startPoint_2 = Curve.StartPoint(curves_2)
endPoint_2 = Curve.EndPoint(curves_2)
byTwoPoints_2 = Vector.ByTwoPoints(start=startPoint_2, end=endPoint_2)
angleWithVector = Vector.AngleWithVector(vector=byTwoPoints, otherVector=byTwoPoints_2)
select_model_element_3 = DSModelElementSelection()
element_ids = Custom[Element Ids](Element_s=select_model_element_3)  # This node will query an element id that can be used with Revit nodes. Dynamo Element Id node returns integer value.
ZAxis = Vector.ZAxis()
code_block = CodeBlock { 22; }
degreesToRadians = Math.DegreesToRadians(code_block)
rotate_family = Custom[Rotate Family](ElementId=element_ids.Rvt_ElementId_s, Axis=ZAxis, Angle=degreesToRadians)  # This node will rotate a family in Revit around a given axis by supplied angle (in radians). Please remember that every time you run your definition it will rotate family by given angle every time.
angleWithVector_2 = Vector.AngleWithVector()
geometry = Element.Geometry(select_model_element_3)
XY = Plane.XY()
rotate = Geometry.Rotate(geometry, XY, code_block)
rotate_2 = Geometry.Rotate()
setRotation = FamilyInstance.SetRotation(familyInstance=select_model_element_3, degree=code_block)
name = Family.Name(select_model_element_3)
plane = ReferencePlane.Plane()
byFamilyType = FamilyInstance.ByFamilyType()
categories = Categories("Sections")
all_families_of_category = Custom[All Families Of Category](category=categories)  # Gets all famiies of a given category in the model (does *not *work for system families)
select_model_element_4 = DSModelElementSelection()  # 1 picked in the model
curves_3 = Element.Curves(select_model_element_4)
code_block_2 = CodeBlock { 0.5; }
pointAtParameter = Curve.PointAtParameter(curve=curves_3, param=code_block_2)
XAxis = Vector.XAxis()
YAxis = Vector.YAxis()

# group: APPLY CS AND WORKPLANE
# note: Generate a plane at the solid center which is orientated to the view cs. This plane is used to detect the boundaries of the section view.
byOriginXAxisYAxis = Plane.ByOriginXAxisYAxis(pointAtParameter, XAxis, YAxis, lacing=Longest)
# note: Defines the coordinate system for the direction of the section view.
# This is taken in the centroid of the solid geometry to be able to define negative and positive values for the min/max point
# Top view:
# X=length axis element
# Y=normal at length axis
# Front view:
# X=length axis element
# Y=Global Z axis
# Cross section view:
# X=normal axis element
# Y=Global Z axis
byOriginVectors = CoordinateSystem.ByOriginVectors(origin=pointAtParameter, xAxis=XAxis, yAxis=XAxis, lacing=Longest)

startPoint_3 = Curve.StartPoint(curves_3)
endPoint_3 = Curve.EndPoint(curves_3)
code_block_3 = CodeBlock { 500; }
translate = Geometry.Translate(geometry=endPoint_3, yTranslation=code_block_3)
byCoordinateSystemMinPointMaxPoint = SectionView.ByCoordinateSystemMinPointMaxPoint(byOriginVectors, startPoint_3, translate)

# group: CREATE SECTION VIEW ACCORDING BOUNDING BOX
# note: The section view is created according the CS, defined by the centroid and the given section view direction.
# The minPoint / maxPoint is defined by the local oriented bounding box + offset of the element.
code_block_4 = CodeBlock { "View Name"; }
setParameterByName = Element.SetParameterByName(element=byCoordinateSystemMinPointMaxPoint, parameterName=code_block_4)

rotate_3 = CoordinateSystem.Rotate()
rotate_4 = CoordinateSystem.Rotate()
byOriginVectors_2 = CoordinateSystem.ByOriginVectors(origin=pointAtParameter, xAxis=XAxis, yAxis=YAxis)
geometry_2 = Element.Geometry(select_model_element_4)
boundingBox = Geometry.BoundingBox(geometry_2)
code_block_5 = CodeBlock { "ciao"; }
setParameterByName_2 = Element.SetParameterByName(parameterName=code_block_4, value=code_block_5)

# group: TRANSLATE TO WCS FOR minPoint / maxPoint Calc
identity = CoordinateSystem.Identity()
transform = Geometry.Transform(contextCoordinateSystem=identity)
# note: As Point.X and Point.Y only work according to global WCS, the curves are transformed from the solid.centroid to the WCS in order to define the MinPoint and MaxPoint of the cut surface (offset values already included)
combine = List.Combine(transform)
X = Point.X(combine)
minimumItem = List.MinimumItem(X)
Y = Point.Y(combine)
minimumItem_2 = List.MinimumItem(Y)
maximumItem = List.MaximumItem(X)
maximumItem_2 = List.MaximumItem(Y)

code_block_6 = CodeBlock { 500; }
code_block_7 = CodeBlock { "cia"; }

# group: CREATE SECTION VIEW ACCORDING BOUNDING BOX
code_block_8 = CodeBlock(CropRegionOffset=code_block_6, ViewDepth=code_block_6)
# ---------- code_block_8.designscript (7 lines) ----------
//Z value calculation
//in accordance with the
//Centroid point
//Startingpoint of sectionview
-CropRegionOffset;
//Relative depth of sectionview
ViewDepth-CropRegionOffset;
# ----------------------------------------
byCoordinates = Point.ByCoordinates(x=minimumItem, y=minimumItem_2, z=code_block_8.out0)
byCoordinates_2 = Point.ByCoordinates(x=maximumItem, y=maximumItem_2, z=code_block_8.out1)
byCoordinateSystemMinPointMaxPoint_2 = SectionView.ByCoordinateSystemMinPointMaxPoint(arg1=byCoordinates, arg2=byCoordinates_2)
# note: The section view is created according the CS, defined by the centroid and the given section view direction.
# The minPoint / maxPoint is defined by the local oriented bounding box + offset of the element.
code_block_9 = CodeBlock { "View Name"; }
setParameterByName_3 = Element.SetParameterByName(element=byCoordinateSystemMinPointMaxPoint_2, parameterName=code_block_9, value=code_block_7)

translate_2 = Geometry.Translate(geometry=startPoint_3, yTranslation=code_block_3)
