# Dynamo graph Section per Line v08.dyn (Dynamo 0.8.2.2392)

# note: With this script it is possible to create automatically aligned section views on selected elements.
# In this script it is already set up for Structural Framing and Structural Columns.
# Necessary inputs are:
# Revit Elements: this to detect the solid.centroid. The views are oriented to that point
# X-vectors and Y-vectors to get the direction of the section plane. Traditionally these vectors are taken from the location lines of linear objects. You might replace this with a selected edge for instance.
# Authored by Dieter Vermeulen, Autodesk, 2015.
# http://revitbeyondbim.wordpress.com

select_model_elements = DSModelElementsSelection()
curves = Element.Curves(select_model_elements)
code_block = CodeBlock { 0.5; }
pointAtParameter = Curve.PointAtParameter(curve=curves, param=code_block)

# group: STRUCTURAL FRAMING LOCAL AXIS DIRECTION
boolean = BoolSelector(false)
reverse = Curve.Reverse(curves)
# note: Reverse section views ?
if_ = If(test=boolean, true=reverse, false=curves)
direction = Line.Direction(if_)
code_block_2 = CodeBlock { 0; }
# note: Normal vector in local y-dir
normalAtParameter = Curve.NormalAtParameter(curve=if_, param=code_block_2)
code_block_3 = CodeBlock { 90; }
# note: Normal vector in local z-dir
rotate = Vector.Rotate(normalAtParameter, direction, code_block_3)

# group: VECTOR DEFINITION STRUCTURAL FRAMING
transpose = List.Transpose(direction)
flatten = Flatten(transpose)
transpose_2 = List.Transpose(rotate)
flatten_2 = Flatten(transpose_2)

# group: APPLY CS AND WORKPLANE
# note: Defines the coordinate system for the direction of the section view.
# This is taken in the centroid of the solid geometry to be able to define negative and positive values for the min/max point
# Top view:
# X=length axis element
# Y=normal at length axis
# Front view:
# X=length axis element
# Y=Global Z axis
# Cross section view:
# X=normal axis element
# Y=Global Z axis
byOriginVectors = CoordinateSystem.ByOriginVectors(origin=pointAtParameter, xAxis=flatten, yAxis=flatten_2, lacing=Longest)
# note: Generate a plane at the solid center which is orientated to the view cs. This plane is used to detect the boundaries of the section view.
byOriginXAxisYAxis = Plane.ByOriginXAxisYAxis(pointAtParameter, flatten, flatten_2, lacing=Longest)

geometry = Element.Geometry(select_model_elements)

# group: DETECT SECTION BOUNDARY CURVES AND WORKPOINTS
intersect = Geometry.Intersect(geometry=geometry, other=byOriginXAxisYAxis, lacing=Longest)

flatten_3 = Flatten(intersect)

# group (continued): DETECT SECTION BOUNDARY CURVES AND WORKPOINTS
# note: Get the single curves and their starting point to define the min and max boundary values
startPoint = Curve.StartPoint(flatten_3)

# group: TRANSLATE TO WCS FOR minPoint / maxPoint Calc
identity = CoordinateSystem.Identity()
transform = Geometry.Transform(contextCoordinateSystem=identity)
# note: As Point.X and Point.Y only work according to global WCS, the curves are transformed from the solid.centroid to the WCS in order to define the MinPoint and MaxPoint of the cut surface (offset values already included)
combine = List.Combine(transform, startPoint, byOriginVectors)
X = Point.X(combine)
minimumItem = List.MinimumItem(X)

code_block_4 = CodeBlock { 1; }
code_block_5 = CodeBlock(a=code_block_4) { -a; }
code_block_6 = CodeBlock { 0; }
code_block_7 = CodeBlock(a=minimumItem) { -a; }
code_block_8 = CodeBlock { 0.5; }
code_block_9 = CodeBlock { 50..63; }
string_from_object = FromObject(code_block_9)
code_block_10 = CodeBlock { 2; }
code_block_11 = CodeBlock { "0"; }
padLeft = String.PadLeft(string_from_object, code_block_10, code_block_11)
code_block_12 = CodeBlock(a=padLeft) { "SECTION GL" + a; }

# group: CREATE SECTION VIEW ACCORDING BOUNDING BOX
byCoordinates = Point.ByCoordinates(x=minimumItem, y=code_block_5, z=code_block_6)
byCoordinates_2 = Point.ByCoordinates(x=code_block_7, y=code_block_4, z=code_block_8)
byCoordinateSystemMinPointMaxPoint = SectionView.ByCoordinateSystemMinPointMaxPoint(byOriginVectors, byCoordinates, byCoordinates_2, lacing=Longest)
# note: The section view is created according the CS, defined by the centroid and the given section view direction.
# The minPoint / maxPoint is defined by the local oriented bounding box + offset of the element.
code_block_13 = CodeBlock { "View Name"; }
setParameterByName = Element.SetParameterByName(element=byCoordinateSystemMinPointMaxPoint, parameterName=code_block_13, value=code_block_12)

reverse_2 = Vector.Reverse(direction)
select_model_elements_2 = DSModelElementsSelection()
setParameterByName_2 = Element.SetParameterByName(element=select_model_elements_2, parameterName=code_block_13, value=code_block_12)
