# Dynamo graph Section01-v2.dyn (Dynamo 2.0.0.4536)

# group: Cross Section (X-Vector)
select_model_element = DSModelElementSelection()  # nothing selected; frozen
localCoordinateSystem = Custom[Element.LocalCoordinateSystem](element=select_model_element)  # Get the insertion point and local axes of an element.
code_block = CodeBlock { [-500,500]; }
translate = Geometry.Translate(geometry=localCoordinateSystem.InsertionPoint, direction=localCoordinateSystem.Xvector, distance=code_block, lacing=Longest)
python_script = Python(IN[0]=select_model_element, IN[2]=localCoordinateSystem.InsertionPoint, IN[3]=translate)  # unwired: IN[1]
# ---------- python_script.python (90 lines) ----------
import clr
clr.AddReference("ProtoGeometry")
from Autodesk.DesignScript.Geometry import *
# Import RevitAPI
clr.AddReference("RevitAPI")
from Autodesk.Revit.DB import *
clr.AddReference("RevitAPIUI")
from Autodesk.Revit.UI import TaskDialog
# Import DocumentManager and TransactionManager
clr.AddReference("RevitServices")
from RevitServices.Persistence import DocumentManager
from RevitServices.Transactions import TransactionManager
# Import ToProtoType, ToRevitType geometry conversion extension methods
clr.AddReference("RevitNodes")
import Revit
clr.ImportExtensions(Revit.GeometryConversion)

doc = DocumentManager.Instance.CurrentDBDocument
uiapp = DocumentManager.Instance.CurrentUIApplication
app = uiapp.Application


wall = UnwrapElement(IN[0])

vft = UnwrapElement(IN[1])

midpoint = UnwrapElement(IN[2])[0].ToXyz()




'start point'
p = UnwrapElement(IN[3])[0].ToXyz()
'end point'
q = UnwrapElement(IN[3])[1].ToXyz()

'wall length'
v = q - p

bb = wall.get_BoundingBox( None )

minZ = bb.Min.Z;
maxZ = bb.Max.Z;


'bb Height'
h = maxZ - minZ;



'section extent in x direction'
offset = 0.1
"""
min = XYZ(-w, minZ - offset, -offset)
max = XYZ(w, maxZ + offset, 0)
(width in plan, height view in section, position in plan)

"""
min = XYZ(-2, -10, 0)
max = XYZ(2, 40, 0.1)



walldir = -v.Normalize() #+- change view direction
up = XYZ.BasisZ;
viewdir = walldir.CrossProduct( up );
 
 
t = Transform.Identity;
t.Origin = XYZ(midpoint.X, midpoint.Y, 0) ;
t.BasisX = walldir;
t.BasisY = up;
t.BasisZ = viewdir


sectionBox = BoundingBoxXYZ();
sectionBox.Transform = t;
sectionBox.Min = min;
sectionBox.Max = max;

	

TransactionManager.Instance.EnsureInTransaction(doc)

section=ViewSection.CreateSection( doc, vft.Id, sectionBox )

TransactionManager.Instance.TransactionTaskDone()


OUT = section, midpoint
# ----------------------------------------

# group: Cross Section (Y-Vector)
select_model_element_2 = DSModelElementSelection()  # nothing selected; frozen
localCoordinateSystem_2 = Custom[Element.LocalCoordinateSystem](element=select_model_element_2)
code_block_2 = CodeBlock { [-500,500]; }
translate_2 = Geometry.Translate(geometry=localCoordinateSystem_2.InsertionPoint, direction=localCoordinateSystem_2.Yvector, distance=code_block_2, lacing=Longest)
python_script_2 = Python(IN[0]=select_model_element_2, IN[2]=localCoordinateSystem_2.InsertionPoint, IN[3]=translate_2)  # unwired: IN[1]; same code as python_script

select_model_elements = DSModelElementsSelection()  # 4 picked in the model

# group: Section Depth from column centreline [ft]
code_block_3 = CodeBlock { [0,500]; }

code_block_4 = CodeBlock { "COBie.Type.NominalWidth"; }
getParameterValueByName = Element.GetParameterValueByName(element=select_model_elements, parameterName=code_block_4)
code_block_5 = CodeBlock { 1000; }

# group: Section Width from column origin [m]
code_block_6 = CodeBlock(a=getParameterValueByName, b=code_block_5) { (a/2+b); }

# group: Section Height from +0.00m [ft]
code_block_7 = CodeBlock { [40000,90000]; }

# group: Cross Section (Y-Vector)
localCoordinateSystem_3 = Custom[Element.LocalCoordinateSystem](element=select_model_elements)
# note: Xvector = section parallel
# Yvector = cross section
code_block_8 = CodeBlock { [-500,500]; }
translate_3 = Geometry.Translate(geometry=localCoordinateSystem_3.InsertionPoint, direction=localCoordinateSystem_3.Xvector, distance=code_block_8@L1)

transpose = List.Transpose(lists=translate_3)

# group (continued): Cross Section (Y-Vector)
python_script_3 = Python(IN[0]=select_model_elements, IN[2]=localCoordinateSystem_3.InsertionPoint, IN[3]=transpose, IN[4]=code_block_3, IN[5]=code_block_6, IN[6]=code_block_7)  # unwired: IN[1]
# ---------- python_script_3.python (86 lines) ----------
import clr
clr.AddReference("ProtoGeometry")
from Autodesk.DesignScript.Geometry import *
# Import RevitAPI
clr.AddReference("RevitAPI")
from Autodesk.Revit.DB import *
clr.AddReference("RevitAPIUI")
from Autodesk.Revit.UI import TaskDialog
# Import DocumentManager and TransactionManager
clr.AddReference("RevitServices")
from RevitServices.Persistence import DocumentManager
from RevitServices.Transactions import TransactionManager
# Import ToProtoType, ToRevitType geometry conversion extension methods
clr.AddReference("RevitNodes")
import Revit
clr.ImportExtensions(Revit.GeometryConversion)

doc = DocumentManager.Instance.CurrentDBDocument
uiapp = DocumentManager.Instance.CurrentUIApplication
app = uiapp.Application


def ToInternalUnits(value):
	getDocUnits = doc.GetUnits()
	getDisplayUnits = getDocUnits.GetFormatOptions(UnitType.UT_Length).DisplayUnits
	return UnitUtils.ConvertToInternalUnits(value, getDisplayUnits)

wall = UnwrapElement(IN[0])

vft = UnwrapElement(IN[1])

sectionList = []


for i in range(0,len(wall)):
	midpoint = UnwrapElement(IN[2])[i].ToXyz()
	'start point'
	p = UnwrapElement(IN[3])[i][0].ToXyz()
	'end point'
	q = UnwrapElement(IN[3])[i][1].ToXyz()
	
	'wall length'
	v = q - p

	bb = wall[i].get_BoundingBox( None )

	minZ = bb.Min.Z;
	maxZ = bb.Max.Z;


	'bb Height'
	h = maxZ - minZ;


	min = XYZ(ToInternalUnits(-IN[5][i]), ToInternalUnits(IN[6][0]), ToInternalUnits(IN[4][0])) #(width in plan, height view in section, position in plan)
	max = XYZ(ToInternalUnits(IN[5][i]), ToInternalUnits(IN[6][1]), ToInternalUnits(IN[4][1]))



	walldir = v.Normalize() #+- change view direction
	up = XYZ.BasisZ;
	viewdir = walldir.CrossProduct( up );
 
 
	t = Transform.Identity;
	t.Origin = XYZ(midpoint.X, midpoint.Y, 0) ;
	t.BasisX = walldir;
	t.BasisY = up;
	t.BasisZ = viewdir


	sectionBox = BoundingBoxXYZ();
	sectionBox.Transform = t;
	sectionBox.Min = min;
	sectionBox.Max = max;

	

	TransactionManager.Instance.EnsureInTransaction(doc)
	
	sectionList.append(ViewSection.CreateSection( doc, vft.Id, sectionBox ))
	
	TransactionManager.Instance.TransactionTaskDone()


OUT = sectionList
# ----------------------------------------
