# Dynamo graph Sections for Selected Walls.dyn (Dynamo 0.8.2.2392)

boolean = BoolSelector(true)

# group: INPUT
wall_types = WallTypes("STR-Conc Insitu Wall Nwt - (300mm)")
select_model_elements = DSModelElementsSelection()  # 3 picked in the model

lunchbox_wall_element_collector = Custom[LunchBox Wall Element Collector](Toggle=boolean, Wall_Type=wall_types)  # Collects wall elements from the Revit document.
string_from_object = FromObject(lunchbox_wall_element_collector.ElementID)
python_script = Python(IN[0]=select_model_elements)
# ---------- python_script.python (36 lines) ----------
#Put view on sheet
import clr
clr.AddReference('RevitAPI')
from Autodesk.Revit.DB import *

clr.AddReference("RevitNodes")
import Revit
clr.ImportExtensions(Revit.Elements)

clr.AddReference("RevitServices")
import RevitServices
from RevitServices.Persistence import DocumentManager
from RevitServices.Transactions import TransactionManager

import clr
clr.AddReference('ProtoGeometry')

from Autodesk.DesignScript.Geometry import *

doc = DocumentManager.Instance.CurrentDBDocument

if isinstance(IN[0], list):
	walls = []
	for i in IN[0]:
		walls.append(UnwrapElement(i))
else:
	walls = [UnwrapElement(IN[0])]


		
wallid = []

for i in walls:
	wallid.append(i.Id)
	
OUT = wallid
# ----------------------------------------
string_from_object_2 = FromObject(python_script)
eq = string_from_object == string_from_object_2  # lacing=CrossProduct
countTrue = CountTrue(eq, lacing=Longest)
code_block = CodeBlock { 1; }
eq_2 = countTrue == code_block  # lacing=CrossProduct
flatten = Flatten(eq_2)
filterByBoolMask = List.FilterByBoolMask(list=lunchbox_wall_element_collector.Element, mask=flatten)
geometry = Element.Geometry(filterByBoolMask.in)
flatten_2 = Flatten(geometry)
centroid = Solid.Centroid(flatten_2)
boolean_2 = BoolSelector(false)
filterByBoolMask_2 = List.FilterByBoolMask(list=lunchbox_wall_element_collector.Location_Curve, mask=flatten)
reverse = Curve.Reverse(filterByBoolMask_2.in)
filterByBoolMask_3 = List.FilterByBoolMask(list=lunchbox_wall_element_collector.Location_Curve, mask=flatten)
if_ = If(test=boolean_2, true=reverse, false=filterByBoolMask_3.in)
direction = Line.Direction(if_)
transpose = List.Transpose(direction)
flatten_3 = Flatten(transpose)
code_block_2 = CodeBlock { 0; }
normalAtParameter = Curve.NormalAtParameter(curve=if_, param=code_block_2)
code_block_3 = CodeBlock { -90; }
rotate = Vector.Rotate(normalAtParameter, direction, code_block_3)
transpose_2 = List.Transpose(rotate)
flatten_4 = Flatten(transpose_2)

# group: APPLY CS AND WORKPLANE
byOriginVectors = CoordinateSystem.ByOriginVectors(origin=centroid, xAxis=flatten_3, yAxis=flatten_4, lacing=Longest)
byOriginXAxisYAxis = Plane.ByOriginXAxisYAxis(centroid, flatten_3, flatten_4, lacing=Longest)

# group: BOUNDARY OFFSETS
crop_region = IntegerSlider(500, range=-500..3000 step 1)
view_depth_number_slider = IntegerSlider(1000, range=0..5000 step 1)

# group: DETECT SECTION BOUNDARY CURVES AND WORKPOINTS
intersect = Geometry.Intersect(geometry=flatten_2, other=byOriginXAxisYAxis, lacing=Longest)
flatten_5 = Flatten(intersect)
perimeterCurves = Surface.PerimeterCurves(flatten_5)
byJoinedCurves = PolyCurve.ByJoinedCurves(perimeterCurves)
code_block_4 = CodeBlock(x=crop_region) { {x,-x}; }
offset = Curve.Offset(curve=byJoinedCurves, distance=code_block_4, lacing=CrossProduct)
isNull = Object.IsNull(offset)
filterByBoolMask_4 = List.FilterByBoolMask(list=offset, mask=isNull)
length = Curve.Length()
maximumItemByKey = MaximumItemByKey(arg1=length)
map = List.Map(list=filterByBoolMask_4.out, f_x=maximumItemByKey)
explode = Geometry.Explode(map)
startPoint = Curve.StartPoint(explode)

# group: TRANSLATE TO WCS FOR minPoint / maxPoint Calc
identity = CoordinateSystem.Identity()
transform = Geometry.Transform(contextCoordinateSystem=identity)
# note: As Point.X and Point.Y only work according to global WCS, the curves are transformed from the solid.centroid to the WCS in order to define the MinPoint and MaxPoint of the cut surface (offset values already included)
combine = List.Combine(transform, startPoint, byOriginVectors)
X = Point.X(combine)
minimumItem = List.MinimumItem(X)
Y = Point.Y(combine)
minimumItem_2 = List.MinimumItem(Y)
maximumItem = List.MaximumItem(X)
maximumItem_2 = List.MaximumItem(Y)

code_block_5 = CodeBlock(CropRegionOffset=crop_region, ViewDepth=view_depth_number_slider)
# ---------- code_block_5.designscript (7 lines) ----------
//Z value calculation
//in accordance with the
//Centroid point
//Startingpoint of sectionview
-CropRegionOffset;
//Relative depth of sectionview
ViewDepth-CropRegionOffset;
# ----------------------------------------
code_block_6 = CodeBlock(Suffix=string_from_object_2) { Suffix; }

# group: CREATE SECTION VIEW ACCORDING BOUNDING BOX
byCoordinates = Point.ByCoordinates(x=minimumItem, y=minimumItem_2, z=code_block_5.out0)
byCoordinates_2 = Point.ByCoordinates(x=maximumItem, y=maximumItem_2, z=code_block_5.out1)
byCoordinateSystemMinPointMaxPoint = SectionView.ByCoordinateSystemMinPointMaxPoint(byOriginVectors, byCoordinates, byCoordinates_2)
code_block_7 = CodeBlock { "View Name"; }
# note: The section view is created according the CS, defined by the centroid and the given section view direction.
# The minPoint / maxPoint is defined by the local oriented bounding box + offset of the element.
setParameterByName = Element.SetParameterByName(element=byCoordinateSystemMinPointMaxPoint, parameterName=code_block_7, value=code_block_6)
