# Dynamo graph Element View Generation Walls v08_r1.dyn (Dynamo 0.8.2.2392)

# note: With this script it is possible to create automatically aligned section views on selected elements.
# In this script it is already set up for Structural Framing and Structural Columns.
# Necessary inputs are:
# Revit Elements: this to detect the solid.centroid. The views are oriented to that point
# X-vectors and Y-vectors to get the direction of the section plane. Traditionally these vectors are taken from the location lines of linear objects. You might replace this with a selected edge for instance.
# Authored by Dieter Vermeulen, Autodesk, 2015.
# http://revitbeyondbim.wordpress.com

# group: STRUCTURAL FRAMING LOCAL AXIS DIRECTION
# note: Reverse section views ?
# note: Normal vector in local z-dir
# note: Normal vector in local y-dir

boolean = BoolSelector(true)
wall_types = WallTypes("STR-Conc Insitu Wall Nwt - (300mm)")
lunchbox_wall_element_collector = Custom[LunchBox Wall Element Collector](Toggle=boolean, Wall_Type=wall_types)  # Collects wall elements from the Revit document.
string_from_object = FromObject(lunchbox_wall_element_collector.ElementID)
select_model_elements = DSModelElementsSelection()  # 2 picked in the model
python_script = Python(IN[0]=select_model_elements)
# ---------- python_script.python (36 lines) ----------
#Put view on sheet
import clr
clr.AddReference('RevitAPI')
from Autodesk.Revit.DB import *

clr.AddReference("RevitNodes")
import Revit
clr.ImportExtensions(Revit.Elements)

clr.AddReference("RevitServices")
import RevitServices
from RevitServices.Persistence import DocumentManager
from RevitServices.Transactions import TransactionManager

import clr
clr.AddReference('ProtoGeometry')

from Autodesk.DesignScript.Geometry import *

doc = DocumentManager.Instance.CurrentDBDocument

if isinstance(IN[0], list):
	walls = []
	for i in IN[0]:
		walls.append(UnwrapElement(i))
else:
	walls = [UnwrapElement(IN[0])]


		
wallid = []

for i in walls:
	wallid.append(i.Id)
	
OUT = wallid
# ----------------------------------------
string_from_object_2 = FromObject(python_script)
eq = string_from_object == string_from_object_2  # lacing=CrossProduct
countTrue = CountTrue(eq, lacing=Longest)
code_block = CodeBlock { 1; }
eq_2 = countTrue == code_block  # lacing=CrossProduct
flatten = Flatten(eq_2)
filterByBoolMask = List.FilterByBoolMask(list=lunchbox_wall_element_collector.Location_Curve, mask=flatten)
filterByBoolMask_2 = List.FilterByBoolMask(list=lunchbox_wall_element_collector.Location_Curve, mask=flatten)
code_block_2 = CodeBlock { 0.5; }
pointAtParameter = Curve.PointAtParameter(curve=filterByBoolMask_2.in, param=code_block_2)
boolean_2 = BoolSelector(false)
reverse = Curve.Reverse(filterByBoolMask_2.in)
if_ = If(test=boolean_2, true=reverse, false=filterByBoolMask.in)
direction = Line.Direction(if_)
transpose = List.Transpose(direction)
flatten_2 = Flatten(transpose)
code_block_3 = CodeBlock { 0; }
normalAtParameter = Curve.NormalAtParameter(curve=if_, param=code_block_3)
code_block_4 = CodeBlock { -90; }
rotate = Vector.Rotate(normalAtParameter, direction, code_block_4)
transpose_2 = List.Transpose(rotate)
flatten_3 = Flatten(transpose_2)

# group: APPLY CS AND WORKPLANE
# note: Generate a plane at the solid center which is orientated to the view cs. This plane is used to detect the boundaries of the section view.
byOriginXAxisYAxis = Plane.ByOriginXAxisYAxis(pointAtParameter, flatten_2, flatten_3, lacing=Longest)
# note: Defines the coordinate system for the direction of the section view.
# This is taken in the centroid of the solid geometry to be able to define negative and positive values for the min/max point
# Top view:
# X=length axis element
# Y=normal at length axis
# Front view:
# X=length axis element
# Y=Global Z axis
# Cross section view:
# X=normal axis element
# Y=Global Z axis
byOriginVectors = CoordinateSystem.ByOriginVectors(origin=pointAtParameter, xAxis=flatten_2, yAxis=flatten_3, lacing=Longest)

# group: DETECT SECTION BOUNDARY CURVES AND WORKPOINTS
intersect = Geometry.Intersect(geometry=filterByBoolMask.in, other=byOriginXAxisYAxis, lacing=Longest)
# note: Detect the perimeter curves of the cutting surface at the solid centroid
flatten_4 = Flatten(intersect)
startPoint = Curve.StartPoint(flatten_4)
perimeterCurves = Surface.PerimeterCurves()
byJoinedCurves = PolyCurve.ByJoinedCurves(perimeterCurves)
code_block_5 = CodeBlock { {x,-x}; }
# note: Apply the offset on the cutting surface perimeter curves.
offset = Curve.Offset(curve=byJoinedCurves, distance=code_block_5, lacing=CrossProduct)
isNull = Object.IsNull(offset)
# note: If the offset value exceeds the half-width of the surface, then it generates a "null" value for the generated polycurve.
# This might return an error in the Curve.Offset node. To filter out the "null" values, the List.FilterByBoolMask is used.
filterByBoolMask_3 = List.FilterByBoolMask(list=offset, mask=isNull)
length = Curve.Length()
# note: Get the external polycurve of the offsetted polycurves.
maximumItemByKey = MaximumItemByKey(arg1=length)
map = List.Map(list=filterByBoolMask_3.out, f_x=maximumItemByKey)
# note: Get the single curves and their starting point to define the min and max boundary values
explode = Geometry.Explode(map)

# group: TRANSLATE TO WCS FOR minPoint / maxPoint Calc
identity = CoordinateSystem.Identity()
transform = Geometry.Transform(contextCoordinateSystem=identity)
# note: As Point.X and Point.Y only work according to global WCS, the curves are transformed from the solid.centroid to the WCS in order to define the MinPoint and MaxPoint of the cut surface (offset values already included)
combine = List.Combine(transform, startPoint, byOriginVectors)
X = Point.X(combine)
maximumItem = List.MaximumItem(X)
Y = Point.Y(combine)
minimumItem = List.MinimumItem(Y)
maximumItem_2 = List.MaximumItem(Y)
minimumItem_2 = List.MinimumItem(X)

# group: BOUNDARY OFFSETS
view_depth_number_slider = IntegerSlider(5000, range=0..5000 step 1)
crop_region = IntegerSlider(1000, range=-500..3000 step 1)

code_block_6 = CodeBlock { -1; }
mul = view_depth_number_slider * code_block_6
code_block_7 = CodeBlock { 0; }
mul_2 = minimumItem_2 * code_block_6
code_block_8 = CodeBlock(Suffix=string_from_object_2) { "Front - " + Suffix; }

# group: CREATE SECTION VIEW ACCORDING BOUNDING BOX
byCoordinates = Point.ByCoordinates(x=minimumItem_2, y=mul, z=code_block_7)
byCoordinates_2 = Point.ByCoordinates(x=mul_2, y=view_depth_number_slider, z=crop_region)
byCoordinateSystemMinPointMaxPoint = SectionView.ByCoordinateSystemMinPointMaxPoint(byOriginVectors, byCoordinates, byCoordinates_2)
# note: The section view is created according the CS, defined by the centroid and the given section view direction.
# The minPoint / maxPoint is defined by the local oriented bounding box + offset of the element.
code_block_9 = CodeBlock { "View Name"; }
setParameterByName = Element.SetParameterByName(element=byCoordinateSystemMinPointMaxPoint, parameterName=code_block_9, value=code_block_8)

filterByBoolMask_4 = List.FilterByBoolMask(list=lunchbox_wall_element_collector.Element, mask=flatten)
geometry = Element.Geometry(filterByBoolMask_4.in)
