# Dynamo graph Section View Clip 1.dyn (Dynamo 1.0.0.1180)

boundingBox = Element.BoundingBox()
code_block = CodeBlock(a=boundingBox) { a.ContextCoordinateSystem; }
code_block_2 = CodeBlock(a=code_block, b=code_block, c=code_block) { a.Origin.X; b.Origin.Y; c.XAxis; }
vector_x = Watch(code_block_2.out2)
minPoint = BoundingBox.MinPoint(boundingBox)
code_block_3 = CodeBlock(a=minPoint) { a.X; }
translate = CoordinateSystem.Translate(code_block, vector_x, code_block_3)
origin = Plane.Origin(translate)
abs = Math.Abs(code_block_3)
maxPoint = BoundingBox.MaxPoint(boundingBox)
code_block_4 = CodeBlock(a=maxPoint) { a.X; }
abs_2 = Math.Abs(code_block_4)
code_block_5 = CodeBlock(a=abs, b=abs_2) { a+b; }
byStartPointDirectionLength = Line.ByStartPointDirectionLength(startPoint=origin, direction=vector_x, length=code_block_5)
get_all_views = Custom[Get All Views]()  # This node will query all views in the model and return them based on category
code_block_6 = CodeBlock { "Far Clip Offset"; }
getParameterValueByName = Element.GetParameterValueByName(element=get_all_views.Sections, parameterName=code_block_6)
code_block_7 = CodeBlock(a=code_block) { a.ZAxis.X; }
watch = Watch(code_block_7)
code_block_8 = CodeBlock(a=getParameterValueByName, b=watch) { a*b*1; }
offset = Curve.Offset(curve=byStartPointDirectionLength, distance=code_block_8)
watch_2 = Watch(get_all_views.Sections)
byCurve = ModelCurve.ByCurve()
views = Views("Project View")
boundingBox_2 = Element.BoundingBox(views)
code_block_9 = CodeBlock(a=boundingBox_2) { a.ContextCoordinateSystem; }
code_block_10 = CodeBlock(a=code_block_9, b=code_block_9, c=code_block_9) { a.Origin.X; b.Origin.Y; c.XAxis; }
origin_x = Watch(code_block_10.out0)
minPoint_2 = BoundingBox.MinPoint(boundingBox_2)
code_block_11 = CodeBlock(a=minPoint_2) { a.X; }
code_block_12 = CodeBlock(a=origin_x, b=code_block_11) { a+b; }
origin_y = Watch(code_block_10.out1)
code_block_13 = CodeBlock { "Far Clip Offset"; }
getParameterValueByName_2 = Element.GetParameterValueByName(element=views, parameterName=code_block_13)
code_block_14 = CodeBlock(a=origin_y, b=getParameterValueByName_2) { a+b; }
byCoordinates = Point.ByCoordinates(x=code_block_12, y=code_block_14)
vector_x_2 = Watch(code_block_10.out2)
maxPoint_2 = BoundingBox.MaxPoint(boundingBox_2)
code_block_15 = CodeBlock(a=maxPoint_2) { a.X; }
code_block_16 = CodeBlock(a=code_block_15) { a*2; }
byStartPointDirectionLength_2 = Line.ByStartPointDirectionLength(startPoint=byCoordinates, direction=vector_x_2, length=code_block_16)
referenceCurveByCurve = ModelCurve.ReferenceCurveByCurve()
watch_3 = Watch(code_block_2.out1)
origin_2 = Point.Origin()
views_2 = Views("Section 4")
view_direction = Python(IN[0]=views_2)
# ---------- view_direction.python (26 lines) ----------
import clr
clr.AddReference('ProtoGeometry')
from Autodesk.DesignScript.Geometry import *

# Import RevitNodes
clr.AddReference("RevitNodes")
import Revit

# Import Revit elements
from Revit.Elements import *

# Import DocumentManager
clr.AddReference("RevitServices")
import RevitServices
from RevitServices.Persistence import DocumentManager

import System



view = UnwrapElement(IN[0])

dir = view.ViewDirection;


OUT = [dir.X,dir.Y,dir.Z]
# ----------------------------------------
code_block_17 = CodeBlock(getitematindex=view_direction) { a=getitematindex[0]; b=getitematindex[1]; c=getitematindex[2]; }
byCoordinates_2 = Point.ByCoordinates(x=code_block_17.a, y=code_block_17.b, z=code_block_17.c)
byTwoPoints = Vector.ByTwoPoints(start=origin_2, end=byCoordinates_2)
origin_3 = Point.Origin()
byTwoPoints_2 = Vector.ByTwoPoints(start=origin_3)
python_script = Python()
# ---------- python_script.python (33 lines) ----------
import clr
clr.AddReference('ProtoGeometry')
from Autodesk.DesignScript.Geometry import *

# Import RevitNodes
clr.AddReference("RevitNodes")
import Revit

# Import Revit elements
from Revit.Elements import *

# Import DocumentManager
clr.AddReference("RevitServices")
import RevitServices
from RevitServices.Persistence import DocumentManager

import System



view = UnwrapElement(IN[0])

direction = []

for v in view:
	#dir = (v.ViewDirection.X,v.ViewDirection.Y,v.ViewDirection.Z)
	#dir = v.UpDirection
	ptX = v.ViewDirection.X
	ptY = v.ViewDirection.Y
	ptZ = v.ViewDirection.Z
	direction.append(Point.ByCoordinates(ptX,ptY,ptZ))
	
OUT = direction
# ----------------------------------------
code_block_18 = CodeBlock { 0; }
getItemAtIndex = List.GetItemAtIndex(list=python_script, index=code_block_18)
watch_4 = Watch(getItemAtIndex)
boundingBox_3 = Element.BoundingBox(views_2)
code_block_19 = CodeBlock(a=boundingBox_3) { a.ContextCoordinateSystem; }
code_block_20 = CodeBlock(c=code_block_19) { c.XAxis; }
minPoint_3 = BoundingBox.MinPoint(boundingBox_3)
code_block_21 = CodeBlock(a=minPoint_3) { a.X; }
translate_2 = CoordinateSystem.Translate(code_block_19, code_block_20, code_block_21)
code_block_22 = CodeBlock(a=translate_2) { a.Origin; }
abs_3 = Math.Abs(code_block_21)
maxPoint_3 = BoundingBox.MaxPoint(boundingBox_3)
code_block_23 = CodeBlock(a=maxPoint_3) { a.X; }
abs_4 = Math.Abs(code_block_23)
code_block_24 = CodeBlock(a=abs_3, b=abs_4) { a+b; }
byStartPointDirectionLength_3 = Line.ByStartPointDirectionLength(startPoint=code_block_22, direction=code_block_20, length=code_block_24)
code_block_25 = CodeBlock { "Far Clip Offset"; }
getParameterValueByName_3 = Element.GetParameterValueByName(element=views_2, parameterName=code_block_25)
offset_2 = Curve.Offset(curve=byStartPointDirectionLength_3, distance=getParameterValueByName_3)
