# Dynamo graph Section View Clip.dyn (Dynamo 1.0.0.1180)

views = Views("Project View")
boundingBox = Element.BoundingBox(views)
code_block = CodeBlock(a=boundingBox) { a.ContextCoordinateSystem; }
code_block_2 = CodeBlock(a=code_block, b=code_block, c=code_block) { a.Origin.X; b.Origin.Y; c.XAxis; }
origin_x = Watch(code_block_2.out0)
minPoint = BoundingBox.MinPoint(boundingBox)
code_block_3 = CodeBlock(a=minPoint) { a.X; }
code_block_4 = CodeBlock(a=origin_x, b=code_block_3) { a+b; }
origin_y = Watch(code_block_2.out1)
code_block_5 = CodeBlock { "Far Clip Offset"; }
getParameterValueByName = Element.GetParameterValueByName(element=views, parameterName=code_block_5)
code_block_6 = CodeBlock(a=origin_y, b=getParameterValueByName) { a+b; }
byCoordinates = Point.ByCoordinates(x=code_block_4, y=code_block_6)
vector_x = Watch(code_block_2.out2)
maxPoint = BoundingBox.MaxPoint(boundingBox)
code_block_7 = CodeBlock(a=maxPoint) { a.X; }
code_block_8 = CodeBlock(a=code_block_7) { a*2; }
byStartPointDirectionLength = Line.ByStartPointDirectionLength(startPoint=byCoordinates, direction=vector_x, length=code_block_8)
views_2 = Views("Section 3")
get_all_views = Custom[Get All Views]()  # This node will query all views in the model and return them based on category
boundingBox_2 = Element.BoundingBox(get_all_views.Sections)
code_block_9 = CodeBlock(a=boundingBox_2) { a.ContextCoordinateSystem; }
code_block_10 = CodeBlock(a=code_block_9, b=code_block_9, c=code_block_9) { a.Origin.X; b.Origin.Y; c.XAxis; }
vector_x_2 = Watch(code_block_10.out2)
minPoint_2 = BoundingBox.MinPoint(boundingBox_2)
code_block_11 = CodeBlock(a=minPoint_2) { a.X; }
translate = CoordinateSystem.Translate(code_block_9, vector_x_2, code_block_11)
origin = Plane.Origin(translate)
abs = Math.Abs(code_block_11)
maxPoint_2 = BoundingBox.MaxPoint(boundingBox_2)
code_block_12 = CodeBlock(a=maxPoint_2) { a.X; }
abs_2 = Math.Abs(code_block_12)
code_block_13 = CodeBlock(a=abs, b=abs_2) { a+b; }
byStartPointDirectionLength_2 = Line.ByStartPointDirectionLength(startPoint=origin, direction=vector_x_2, length=code_block_13)
code_block_14 = CodeBlock { "Far Clip Offset"; }
getParameterValueByName_2 = Element.GetParameterValueByName(element=get_all_views.Sections, parameterName=code_block_14)
offset = Curve.Offset(curve=byStartPointDirectionLength_2, distance=getParameterValueByName_2)
watch = Watch(get_all_views.Sections)
