# Dynamo graph Select Framings.dyn (Dynamo 0.8.2.2392)

categories = Categories("StructuralFraming")
all_elements_of_category = ElementsOfCategory(categories)
# note: Instances
watch = Watch(all_elements_of_category)
get_system_types_as_list = Custom[Get System Types as List]()  # uses HostObjAttributes parent class to collect
watch_2 = Watch(get_system_types_as_list)
unusedTypes = Custom[Tool.UnusedTypes](Category=categories)  # collects unused types in model before deletion
string_from_object = FromObject(unusedTypes)
code_block = CodeBlock { "dp x"; }
contains = String.Contains(str=string_from_object, searchFor=code_block)
filterByBoolMask = List.FilterByBoolMask(list=unusedTypes, mask=contains)
watch_3 = Custom[Watch+](input=filterByBoolMask.in)  # This node that serializes the input information and presents it in a resizable text window.
python_script = Python()
# ---------- python_script.python (20 lines) ----------
import System
import clr
clr.AddReference('RevitAPI')
from Autodesk.Revit.DB import *

clr.AddReference("RevitServices")
import RevitServices
from RevitServices.Persistence import DocumentManager

doc = DocumentManager.Instance.CurrentDBDocument
cats = IN[0]

elementlist = []
for item in cats:
	collector = FilteredElementCollector(doc)
	collector.OfClass(FamilySymbol)
	bic = System.Enum.ToObject(BuiltInCategory, item.Id)
	collector.OfCategory(bic)
	elementlist.append(collector.ToElements())
OUT =collector.ToElements()
# ----------------------------------------
python_script_2 = Python()
# ---------- python_script_2.python (33 lines) ----------
import clr
# Import DocumentManager and TransactionManager
clr.AddReference("RevitServices")
import RevitServices
from RevitServices.Persistence import DocumentManager

# Import RevitAPI
clr.AddReference("RevitAPI")
import Autodesk
from Autodesk.Revit.DB import *


doc = DocumentManager.Instance.CurrentDBDocument
cats = IN[0]

elementlist = []
"""
for item in cats:

collector = FilteredElementCollector(doc)

collector.OfClass(FamilySymbol)

bic = System.Enum.ToObject(BuiltInCategory, item.Id)

collector.OfCategory(bic)

elementlist.append(collector.ToElements())
"""
collector = FilteredElementCollector(doc).OfCategory(BuiltInCategory.OST_StructuralFraming).WhereElementIsElementType()


OUT =collector.ToElements()
# ----------------------------------------
string_from_object_2 = FromObject(python_script_2)
code_block_2 = CodeBlock { "STR-Conc-Insitu Beam"; }
boolean = BoolSelector(true)
contains_2 = String.Contains(str=string_from_object_2, searchFor=code_block_2, ignoreCase=boolean)
filterByBoolMask_2 = List.FilterByBoolMask(list=python_script_2, mask=contains_2)
symbol = FamilyInstance.Symbol(all_elements_of_category)
