# Dynamo graph Set Parameter Element Active view.dyn (Dynamo 0.8.2.2392)

all_elements_in_active_view = ElementsInView()
name = Element.Name(all_elements_in_active_view)
code_block = CodeBlock { "1000 x"; }
contains = String.Contains(str=name, searchFor=code_block)
filterByBoolMask = List.FilterByBoolMask(list=all_elements_in_active_view, mask=contains)
watch = Watch(filterByBoolMask.in)
code_block_2 = CodeBlock { "RC Column Mark"; }
code_block_3 = CodeBlock { "Column Location Mark"; }
getParameterValueByName = Element.GetParameterValueByName(element=watch, parameterName=code_block_3)
setParameterByName = Element.SetParameterByName(element=watch, parameterName=code_block_2, value=getParameterValueByName)
