# Dynamo graph Set Titleblock Name.dyn (Dynamo 0.8.2.2392)

categories = Categories("Sheets")
all_elements_of_category = ElementsOfCategory(categories)
watch = Watch(all_elements_of_category)
code_block = CodeBlock { "Sheet Number"; }
getParameterValueByName = Element.GetParameterValueByName(element=watch, parameterName=code_block)
string = StringInput("406301")
eq = getParameterValueByName == string  # lacing=CrossProduct
countTrue = CountTrue(eq, lacing=Longest)
code_block_2 = CodeBlock { 1; }
eq_2 = countTrue == code_block_2  # lacing=CrossProduct
flatten = Flatten(eq_2)
filterByBoolMask = List.FilterByBoolMask(list=watch, mask=flatten)
setParameterByName = Element.SetParameterByName(element=filterByBoolMask.in)
file_path = Filename("X:\4 Internal Data\05 1F4\08 BIM\02 Structural\Links\10 Excel\01_Substructure\Titleblock Dynamo.xlsx")
fromPath = FileObject(file_path)  # "File.FromPath"
code_block_3 = CodeBlock { "Sheet1"; }
readFromFile = Excel.ReadFromFile(file=fromPath, sheetName=code_block_3)
transpose = List.Transpose(readFromFile)
firstItem = List.FirstItem(transpose)
lastItem = List.LastItem(transpose)
combine = List.Combine(setParameterByName, firstItem, lastItem)
categories_2 = Categories("TitleBlocks")
all_elements_of_category_2 = ElementsOfCategory(categories_2)
watch_2 = Watch(all_elements_of_category_2)
python_script = Python(IN[0]=watch_2)
# ---------- python_script.python (16 lines) ----------
import clr
clr.AddReference('RevitAPI')
from Autodesk.Revit.DB import *

clr.AddReference("RevitNodes")
import Revit
clr.ImportExtensions(Revit.Elements)

items = UnwrapElement(IN[0])
elementlist = list()
for item in items:
	try:
		elementlist.append(item.Document.GetElement(item.OwnerViewId).ToDSType(True))
	except:
		elementlist.append(list())
OUT = elementlist
# ----------------------------------------
code_block_4 = CodeBlock { "Sheet Number"; }
getParameterValueByName_2 = Element.GetParameterValueByName(element=python_script, parameterName=code_block_4)
eq_3 = getParameterValueByName_2 == string  # lacing=CrossProduct
countTrue_2 = CountTrue(eq_3, lacing=Longest)
code_block_5 = CodeBlock { 1; }
eq_4 = countTrue_2 == code_block_5  # lacing=CrossProduct
flatten_2 = Flatten(eq_4)
filterByBoolMask_2 = List.FilterByBoolMask(list=all_elements_of_category_2, mask=flatten_2)
code_block_6 = CodeBlock { "Not For Construction"; }
code_block_7 = CodeBlock { 1; }
setParameterByName_2 = Element.SetParameterByName(element=filterByBoolMask_2.in, parameterName=code_block_6, value=code_block_7)
select_model_element = DSModelElementSelection()  # 1 picked in the model
code_block_8 = CodeBlock { "RM_North Arrow"; }
code_block_9 = CodeBlock { 0; }
setParameterByName_3 = Element.SetParameterByName(element=filterByBoolMask_2.in, parameterName=code_block_8, value=code_block_9)
code_block_10 = CodeBlock { "General Notes"; }
code_block_11 = CodeBlock { 0; }
setParameterByName_4 = Element.SetParameterByName(element=filterByBoolMask_2.in, parameterName=code_block_10, value=code_block_11)
