# Dynamo graph piles.dyn (Dynamo 1.0.0.1180)

# group: INPUTS
family_types = FamilyTypes("Concrete Round:300mm")
select_model_element = DSModelElementSelection()  # 1 picked in the model
code_block = CodeBlock { 10; }
levels = Levels("Level 1")

curves = Element.Curves(select_model_element)
startPoint = Curve.StartPoint(curves)
pointsAtEqualSegmentLength = Curve.PointsAtEqualSegmentLength(curve=curves, divisions=code_block)
endPoint = Curve.EndPoint(curves)
create = List.Create(startPoint, pointsAtEqualSegmentLength, endPoint)
flatten = Flatten(create)
byPointAndLevel = FamilyInstance.ByPointAndLevel(familyType=family_types, point=flatten, level=levels)

# group: SET OFFSET
code_block_2 = CodeBlock { "Top Offset"; }
code_block_3 = CodeBlock { -5000; }

setParameterByName = Element.SetParameterByName(element=byPointAndLevel, parameterName=code_block_2, value=code_block_3)

# group: SET LEVEL
levels_2 = Levels("Level 2")
code_block_4 = CodeBlock { "Top Level"; }
