# Dynamo graph Place active view on selected sheet.dyn (Dynamo 0.8.2.2392)

categories = Categories("Sheets")
all_elements_of_category = ElementsOfCategory(categories)
watch = Watch(all_elements_of_category)
code_block = CodeBlock { "Sheet Number"; }
getParameterValueByName = Element.GetParameterValueByName(element=watch, parameterName=code_block)

# group: INPUT: SHEET NUMBER
# note: 13.10.2016
# Dynamo 0.8
string = StringInput("095601")

eq = getParameterValueByName == string  # lacing=CrossProduct
countTrue = CountTrue(eq, lacing=Longest)
code_block_2 = CodeBlock { 1; }
eq_2 = countTrue == code_block_2  # lacing=CrossProduct
flatten = Flatten(eq_2)
filterByBoolMask = List.FilterByBoolMask(list=watch, mask=flatten)
flatten_2 = Flatten(filterByBoolMask.in)
boolean = BoolSelector(true)
active_view = Custom[Active View](refresh=boolean)

# group: POSITION
# note: Right
code_block_3 = CodeBlock { 563; }
code_block_4 = CodeBlock(a=code_block_3) { a/304; }
# note: Bottom
code_block_5 = CodeBlock { 156; }
code_block_6 = CodeBlock(b=code_block_5) { b/304; }
# note: Left
code_block_7 = CodeBlock { 188; }
# note: Top
code_block_8 = CodeBlock { 438; }

# note: Sheet
# note: View
# note: Pt x
# note: Pt y
python_script = Python(IN[0]=flatten_2, IN[1]=active_view, IN[2]=code_block_4, IN[3]=code_block_6)
# ---------- python_script.python (74 lines) ----------
#Put view on sheet
import clr
clr.AddReference('RevitAPI')
from Autodesk.Revit.DB import *

clr.AddReference("RevitNodes")
import Revit
clr.ImportExtensions(Revit.Elements)

clr.AddReference("RevitServices")
import RevitServices
from RevitServices.Persistence import DocumentManager
from RevitServices.Transactions import TransactionManager

import clr
clr.AddReference('ProtoGeometry')

from Autodesk.DesignScript.Geometry import *

doc = DocumentManager.Instance.CurrentDBDocument

if isinstance(IN[0], list):
	sheets = []
	for i in IN[0]:
		sheets.append(UnwrapElement(i))
else:
	sheets = [UnwrapElement(IN[0])]
	
	
if isinstance(IN[1], list):
	views = []
	for i in IN[1]:
		views.append(UnwrapElement(i))
else:
	views = [UnwrapElement(IN[1])]


if isinstance(IN[2], list):
	ptx = []
	for i in IN[2]:
		ptx.append(float(UnwrapElement(i)))
else:
	ptx = [UnwrapElement(IN[2])]


if isinstance(IN[3], list):
	pty = []
	for i in IN[3]:
		pty.append(float(UnwrapElement(i)))
else:
	pty = [UnwrapElement(IN[3])]

pts=[]

for j,k in zip(ptx,pty):
	pts.append(Point.ByCoordinates(j,k))
	

TransactionManager.Instance.EnsureInTransaction(doc) # you need an active transaction as you will create elements

vport=[]

for i in views:
	vport.append(Viewport.Create(doc,sheets[0].Id,i.Id,XYZ.Zero))

for v,p in zip(vport,pts):
	v.SetBoxCenter(XYZ(p.X,p.Y,p.Z))
	
	
TransactionManager.Instance.TransactionTaskDone()		



OUT = pts
# ----------------------------------------
name = Element.Name(active_view)
