# Dynamo graph Select viewports.dyn (Dynamo 0.8.2.2392)

symbols = Family.Symbols()
element_types = ElementTypes("Viewport")
all_elements_of_type = ElementsOfType(element_types)
watch = Watch(all_elements_of_type)
name = FamilySymbol.Name(watch)
categories = Categories("Viewports")
all_elements_of_category = ElementsOfCategory(categories)
watch_2 = Watch(all_elements_of_category)
name_2 = FamilySymbol.Name(watch_2)
watch_3 = Custom[Watch+](input=watch_2)  # This node that serializes the input information and presents it in a resizable text window.
