# Dynamo graph Set Viewport Position.dyn (Dynamo 0.8.2.2392)

code_block = CodeBlock { "Sheet 1"; }
code_block_2 = CodeBlock { 0; }

# group: SELECT VIEWS ON SHEET
select_model_elements = DSModelElementsSelection()

code_block_3 = CodeBlock { "View Name"; }
getParameterValueByName = Element.GetParameterValueByName(element=select_model_elements, parameterName=code_block_3)
viewPortBoxCenter = Custom[View.ViewPortBoxCenter](Viewports=select_model_elements)  # Get ViewPort Box center point
create = List.Create(getParameterValueByName, viewPortBoxCenter)
boolean = BoolSelector(true)

# group: WRITE
writeToFile = Excel.WriteToFile(sheetName=code_block, startRow=code_block_2, startCol=code_block_2, data=create, overWrite=boolean)

categories = Categories("Sheets")
all_elements_of_category = ElementsOfCategory(categories)
watch = Watch(all_elements_of_category)
code_block_4 = CodeBlock { "Sheet Number"; }
getParameterValueByName_2 = Element.GetParameterValueByName(element=watch, parameterName=code_block_4)

# group: SHEET NUMBER
code_block_5 = CodeBlock { "091003"; }

eq = getParameterValueByName_2 == code_block_5  # lacing=CrossProduct
countTrue = CountTrue(eq, lacing=Longest)
code_block_6 = CodeBlock { 1; }
eq_2 = countTrue == code_block_6  # lacing=CrossProduct
flatten = Flatten(eq_2)
filterByBoolMask = List.FilterByBoolMask(list=watch, mask=flatten)
flatten_2 = Flatten(filterByBoolMask.in)
element_types = ElementTypes("ViewPlan")
all_elements_of_type = ElementsOfType(element_types)
name = Element.Name(all_elements_of_type)

# group: EXCEL FILE TO STORE VIEWPORTS CENTERPOINTS
file_path = Filename("C:\Users\giovanni.brogioli\Documents\Dynamo\New Microsoft Excel Worksheet.xlsx")

fromPath = FileObject(file_path)  # "File.FromPath"

# group: READ
readFromFile = Excel.ReadFromFile(file=fromPath, sheetName=code_block)

code_block_7 = CodeBlock { 0; }
getItemAtIndex = List.GetItemAtIndex(list=readFromFile, index=code_block_7)
eq_3 = name == getItemAtIndex  # lacing=CrossProduct
countTrue_2 = CountTrue(eq_3, lacing=Longest)
code_block_8 = CodeBlock { 1; }
eq_4 = countTrue_2 == code_block_8  # lacing=CrossProduct
flatten_3 = Flatten(eq_4)
filterByBoolMask_2 = List.FilterByBoolMask(list=all_elements_of_type, mask=flatten_3)
code_block_9 = CodeBlock { 1; }
getItemAtIndex_2 = List.GetItemAtIndex(list=readFromFile, index=code_block_9)
code_block_10 = CodeBlock { "("; }
code_block_11 = CodeBlock { ","; }
code_block_12 = CodeBlock { ")"; }
split = String.Split(getItemAtIndex_2, code_block_10, code_block_11, code_block_12)
code_block_13 = CodeBlock { 0; }
getItemAtIndex_3 = List.GetItemAtIndex(index=code_block_13)
map = List.Map(list=split, f_x=getItemAtIndex_3)
code_block_14 = CodeBlock { 1; }
getItemAtIndex_4 = List.GetItemAtIndex(index=code_block_14)
map_2 = List.Map(list=split, f_x=getItemAtIndex_4)
python_script = Python(IN[0]=flatten_2, IN[1]=filterByBoolMask_2.in, IN[2]=map, IN[3]=map_2)
# ---------- python_script.python (70 lines) ----------
#Put view on sheet
import clr
clr.AddReference('RevitAPI')
from Autodesk.Revit.DB import *

clr.AddReference("RevitNodes")
import Revit
clr.ImportExtensions(Revit.Elements)

clr.AddReference("RevitServices")
import RevitServices
from RevitServices.Persistence import DocumentManager
from RevitServices.Transactions import TransactionManager

import clr
clr.AddReference('ProtoGeometry')

from Autodesk.DesignScript.Geometry import *

doc = DocumentManager.Instance.CurrentDBDocument

if isinstance(IN[0], list):
	sheets = []
	for i in IN[0]:
		sheets.append(UnwrapElement(i))
else:
	sheets = [UnwrapElement(IN[0])]
	
	
if isinstance(IN[1], list):
	views = []
	for i in IN[1]:
		views.append(UnwrapElement(i))
else:
	views = [UnwrapElement(IN[1])]


if isinstance(IN[2], list):
	ptx = []
	for i in IN[2]:
		ptx.append(float(UnwrapElement(i)))


if isinstance(IN[3], list):
	pty = []
	for i in IN[3]:
		pty.append(float(UnwrapElement(i)))

pts=[]
for j,k in zip(ptx,pty):
	pts.append(Point.ByCoordinates(j,k))
	
	
TransactionManager.Instance.EnsureInTransaction(doc) # you need an active transaction as you will create elements

vport=[]

for i in views:
	vport.append(Viewport.Create(doc,sheets[0].Id,i.Id,XYZ.Zero))

for v,p in zip(vport,pts):
	v.SetBoxCenter(XYZ(p.X,p.Y,p.Z))
	
	
TransactionManager.Instance.TransactionTaskDone()		




OUT = pts
# ----------------------------------------
