# Dynamo graph VIEW POSITION2.dyn (Dynamo 0.8.2.2392)

categories = Categories("Sheets")
all_elements_of_category = ElementsOfCategory(categories)
watch = Watch(all_elements_of_category)
code_block = CodeBlock { "Sheet Number"; }
getParameterValueByName = Element.GetParameterValueByName(element=watch, parameterName=code_block)
code_block_2 = CodeBlock { "030106"; }
create = List.Create(code_block_2)
eq = getParameterValueByName == create  # lacing=CrossProduct
countTrue = CountTrue(eq, lacing=Longest)
code_block_3 = CodeBlock { 1; }
eq_2 = countTrue == code_block_3  # lacing=CrossProduct
flatten = Flatten(eq_2)
filterByBoolMask = List.FilterByBoolMask(list=watch, mask=flatten)
code_block_4 = CodeBlock { "TB_Description"; }
code_block_5 = CodeBlock { "100% FINAL DESIGN"; }
setParameterByName = Element.SetParameterByName(element=filterByBoolMask.in, parameterName=code_block_4, value=code_block_5)
