# Dynamo graph view position6.dyn (Dynamo 0.8.2.2392)

select_model_elements = DSModelElementsSelection()
setBoxCenter = Custom[Viewport.SetBoxCenter](Viewport_list=select_model_elements)  # API class
categories = Categories("Sheets")
all_elements_of_category = ElementsOfCategory(categories)
watch = Watch(all_elements_of_category)
code_block = CodeBlock { "Sheet Number"; }
getParameterValueByName = Element.GetParameterValueByName(element=watch, parameterName=code_block)
code_block_2 = CodeBlock { "030106"; }
eq = getParameterValueByName == code_block_2  # lacing=CrossProduct
countTrue = CountTrue(eq, lacing=Longest)
code_block_3 = CodeBlock { 1; }
eq_2 = countTrue == code_block_3  # lacing=CrossProduct
flatten = Flatten(eq_2)
filterByBoolMask = List.FilterByBoolMask(list=watch, mask=flatten)
flatten_2 = Flatten(filterByBoolMask.in)
views = Sheet.Views(flatten_2)
boundingBox = Geometry.BoundingBox(views)
maxPoint = BoundingBox.MaxPoint(boundingBox)
minPoint = BoundingBox.MinPoint(boundingBox)
code_block_4 = CodeBlock(a=maxPoint, b=minPoint) { (a.X+b.X)/2; }
code_block_5 = CodeBlock(a=maxPoint, b=minPoint) { (a.Y+b.Y)/2; }
code_block_6 = CodeBlock(a=maxPoint, b=minPoint) { (a.Z+b.Z)/2; }
byCoordinates = Point.ByCoordinates(x=code_block_4, y=code_block_5, z=code_block_6)
setBoxCenter_2 = Custom[Viewport.SetBoxCenter]()
code_block_7 = CodeBlock { "Sheet Name"; }
getParameterValueByName_2 = Element.GetParameterValueByName(element=flatten_2, parameterName=code_block_7)
code_block_8 = CodeBlock { "Sheet 1"; }
code_block_9 = CodeBlock { 0; }
select_model_elements_2 = DSModelElementsSelection()
code_block_10 = CodeBlock { "View Name"; }
getParameterValueByName_3 = Element.GetParameterValueByName(element=select_model_elements_2, parameterName=code_block_10)
viewPortBoxCenter = Custom[View.ViewPortBoxCenter](Viewports=select_model_elements_2)  # Get ViewPort Box center point
create = List.Create(getParameterValueByName_3, viewPortBoxCenter)
boolean = BoolSelector(true)
writeToFile = Excel.WriteToFile(sheetName=code_block_8, startRow=code_block_9, startCol=code_block_9, data=create, overWrite=boolean)
element_types = ElementTypes("ViewSection")
all_elements_of_type = ElementsOfType(element_types)
name = Element.Name(all_elements_of_type)
file_path = Filename("C:\Users\giovanni.brogioli\Documents\Dynamo\New Microsoft Excel Worksheet.xlsx")
fromPath = FileObject(file_path)  # "File.FromPath"
readFromFile = Excel.ReadFromFile(file=fromPath, sheetName=code_block_8)
code_block_11 = CodeBlock { 0; }
getItemAtIndex = List.GetItemAtIndex(list=readFromFile, index=code_block_11)
eq_3 = name == getItemAtIndex  # lacing=CrossProduct
countTrue_2 = CountTrue(eq_3, lacing=Longest)
code_block_12 = CodeBlock { 1; }
eq_4 = countTrue_2 == code_block_12  # lacing=CrossProduct
flatten_3 = Flatten(eq_4)
filterByBoolMask_2 = List.FilterByBoolMask(list=all_elements_of_type, mask=flatten_3)
code_block_13 = CodeBlock { 1; }
getItemAtIndex_2 = List.GetItemAtIndex(list=readFromFile, index=code_block_13)
code_block_14 = CodeBlock { "("; }
code_block_15 = CodeBlock { ","; }
code_block_16 = CodeBlock { ")"; }
split = String.Split(getItemAtIndex_2, code_block_14, code_block_15, code_block_16)
code_block_17 = CodeBlock { 0; }
getItemAtIndex_3 = List.GetItemAtIndex(index=code_block_17)
map = List.Map(list=split, f_x=getItemAtIndex_3)
code_block_18 = CodeBlock { 1; }
getItemAtIndex_4 = List.GetItemAtIndex(index=code_block_18)
map_2 = List.Map(list=split, f_x=getItemAtIndex_4)
python_script = Python(IN[0]=flatten_2, IN[1]=filterByBoolMask_2.in, IN[2]=map, IN[3]=map_2)
# ---------- python_script.python (66 lines) ----------
#Put view on sheet
import clr
clr.AddReference('RevitAPI')
from Autodesk.Revit.DB import *

clr.AddReference("RevitNodes")
import Revit
clr.ImportExtensions(Revit.Elements)

clr.AddReference("RevitServices")
import RevitServices
from RevitServices.Persistence import DocumentManager
from RevitServices.Transactions import TransactionManager


doc = DocumentManager.Instance.CurrentDBDocument

if isinstance(IN[0], list):
	sheets = []
	for i in IN[0]:
		sheets.append(UnwrapElement(i))
else:
	sheets = [UnwrapElement(IN[0])]
	
	
if isinstance(IN[1], list):
	views = []
	for i in IN[1]:
		views.append(UnwrapElement(i))
else:
	views = [UnwrapElement(IN[1])]


if isinstance(IN[2], list):
	ptx = []
	for i in IN[2]:
		ptx.append(float(UnwrapElement(i)))
else:
	ptx = float[UnwrapElement(IN[2])]


if isinstance(IN[3], list):
	pty = []
	for i in IN[3]:
		pty.append(float(UnwrapElement(i)))
else:
	pty = float([UnwrapElement(IN[3])])

TransactionManager.Instance.EnsureInTransaction(doc) # you need an active transaction as you will create elements


#for v,p in zip(views,ptx):
#	Viewport.Create(doc,sheets[0].Id,v.Id,XYZ(0,0,0)
pts=[]

for j,k in zip(ptx,pty):
	pts.append((j,k,0))

for i in views:
	Viewport.Create(doc,sheets[0].Id,i.Id,XYZ(0,0,0)
	
		#	pts.append(Point.ByCoordinates(i,k))
TransactionManager.Instance.TransactionTaskDone()


OUT = pts
# ----------------------------------------
code_block_19 = CodeBlock { 0; }
python_script_2 = Python(IN[0]=map_2)
# ---------- python_script_2.python (19 lines) ----------
import clr
clr.AddReference('ProtoGeometry')
from Autodesk.DesignScript.Geometry import *
#The inputs to this node will be stored as a list in the IN variables.
dataEnteringNode = IN


ptz=[]

for i in IN[0]:
	ptz.append(float(UnwrapElement(i)))
#Assign your output to the OUT variable.

ptc = []

for i in range(0,len(ptz)):
	ptc.append(ptz[i])
	
OUT = ptc
# ----------------------------------------
code_block_20 = CodeBlock { 0; }
getItemAtIndex_5 = List.GetItemAtIndex(list=python_script_2, index=code_block_20)
code_block_21 = CodeBlock { 1; }
getItemAtIndex_6 = List.GetItemAtIndex(list=python_script_2, index=code_block_21)
code_block_22 = CodeBlock(a=getItemAtIndex_5, b=getItemAtIndex_6) { a+b; }
watch_2 = Watch(getItemAtIndex_5)
select_model_elements_3 = DSModelElementsSelection()
setBoxCenter_3 = Custom[Viewport.SetBoxCenter](Viewport_list=select_model_elements_3)
lunchbox_string_to_point = Custom[LunchBox String to Point](String=getItemAtIndex_2)  # Converts a point string "x,y,z" into a true Point.
code_block_23 = CodeBlock(a=map, b=map_2) { Point.ByCoordinates(a,b); }
python_script_3 = Python(IN[0]=map, IN[1]=map_2)
# ---------- python_script_3.python (27 lines) ----------
import clr
clr.AddReference('ProtoGeometry')
from Autodesk.DesignScript.Geometry import *
#The inputs to this node will be stored as a list in the IN variables.
dataEnteringNode = IN

if isinstance(IN[0], list):
	ptx = []
	for i in IN[0]:
		ptx.append(float(UnwrapElement(i)))

if isinstance(IN[1], list):
	pty = []
	for i in IN[1]:
		pty.append(float(UnwrapElement(i)))

pts=[]
#for i in range(0,len(ptx)):
#	pts.append(Point.ByCoordinates(ptx[i],pty[i]))


for i,k in zip(ptx,pty):
	pts.append(Point.ByCoordinates(i,k))


#Assign your output to the OUT variable.
OUT = pts
# ----------------------------------------
watch_3 = Watch(python_script_3)
