# Dynamo graph SetFamilyMaterial.dyn (Dynamo 1.2.3.592)

wall_types = WallTypes("STR-Conc Precast Wall Lwt-1800 (300mm)")
code_block = CodeBlock { 0; }
code_block_2 = CodeBlock { "Glass"; }
byName = Material.ByName(code_block_2)
setCompoundLayerMaterial = Custom[FamilyType.SetCompoundLayerMaterial](familyType=wall_types, layerIndex=code_block, material=byName)  # Sets the material of a specified compound layer of a given family type (only applies to family types that have a compound structure, e.g. walls, floors etc.).
