# Dynamo graph SetFilledRegionLineStyle02.dyn (Dynamo 1.3.0.875)

select_model_elements = DSModelElementsSelection()
get_revit_activeview = Custom[Get Revit ActiveView]()  # Active View
python_script = Python(IN[0]=select_model_elements, IN[1]=get_revit_activeview)
# ---------- python_script.python (50 lines) ----------
import clr
clr.AddReference('ProtoGeometry')
from Autodesk.DesignScript.Geometry import *

# Import DocumentManager and TransactionManager
clr.AddReference("RevitServices")
import RevitServices
from RevitServices.Persistence import DocumentManager
from RevitServices.Transactions import TransactionManager

# Import RevitAPI
clr.AddReference("RevitAPI")
import Autodesk
from Autodesk.Revit.DB import *

clr.AddReference("RevitNodes")
import Revit
clr.ImportExtensions(Revit.GeometryConversion)


doc = DocumentManager.Instance.CurrentDBDocument
uiapp = DocumentManager.Instance.CurrentUIApplication
app = uiapp.Application


region = UnwrapElement(IN[0])

view = UnwrapElement(IN[1])

geomOption = app.Create.NewGeometryOptions()
geomOption.View = view
geomOption.IncludeNonVisibleObjects = 0

edgeArray = []
for r in region:
	geomElem = r.get_Geometry(geomOption)
	enum1 = geomElem.GetEnumerator() ; enum1.MoveNext()
	geo2 = enum1.Current
	edgeArray.append(geo2.Edges)

lineStyles = []

for i in range(0,len(edgeArray)):
	ls =[]
	lineStyles.append(ls)
	for edge in edgeArray[i]:
		ls.append(doc.GetElement(edge.GraphicsStyleId))

#Assign your outputs to the OUT variable
OUT = lineStyles
# ----------------------------------------
