# Dynamo graph SlabNoPenetrationZones.dyn (Dynamo 1.3.1.1736)

get_revit_activeview = Custom[Get Revit ActiveView]()  # Active View
select_model_elements = DSModelElementsSelection()  # 4 picked in the model
getLocation = Element.GetLocation(select_model_elements)
deconstructPoint = Geometry.Points.DeconstructPoint(getLocation)
code_block = CodeBlock { 0..2000..#11; }
code_block_2 = CodeBlock { 0..360..10; }
code_block_3 = CodeBlock(deconstructPoint.out0, code_block, code_block_2, deconstructPoint.out1) { x=PtX<1L>+r<1L>*Math.Cos(t<1L>); y=PtY<1L>+r<1L>*Math.Sin(t<1L>); 0; }
byCoordinates = Point.ByCoordinates(x=code_block_3.x, y=code_block_3.y, z=code_block_3.out2)
flatten = Flatten(byCoordinates)
code_block_4 = CodeBlock { 1; }
count = List.Count(flatten)
cycle = List.Cycle(list=code_block_4, amount=count)
code_block_5 = CodeBlock { "Penetration Zoning"; "Red No, Orange TBC"; null; }
byViewPointsAndValues = Revit.AnalysisDisplay.PointAnalysisDisplay.ByViewPointsAndValues(get_revit_activeview, flatten, cycle, code_block_5.out0, code_block_5.out1, code_block_5.out2)
