# Dynamo graph SortCurves.dyn (Dynamo 1.3.1.1736)

intersectAll = Curve.IntersectAll()  # unwired: arg0
select_model_elements = DSModelElementsSelection()  # 5 picked in the model
curves = Element.Curves(select_model_elements)
flatten = Flatten(curves)
startPoint = Curve.StartPoint(flatten)  # frozen
endPoint = Curve.EndPoint(flatten)  # frozen
code_block = CodeBlock(A=startPoint, B=endPoint) { {A,B}; }
distanceTo = Geometry.DistanceTo(geometry=flatten, other=code_block, lacing=CrossProduct)
code_block_2 = CodeBlock(A=distanceTo) { A<0.1; }
filterByBoolMask = List.FilterByBoolMask()  # unwired: list, mask
code_block_3 = CodeBlock { DesignScript.Curve.PointAtParameter(0,1); }
code_block_4 = CodeBlock(t1=flatten, t2=code_block) { t3 = t1<1>.DistanceTo(t2<2>); }
code_block_5 = CodeBlock(a=flatten) { a[0]; }  # frozen
python_script = Python(IN[0]=code_block_5)
# ---------- python_script.python (24 lines) ----------
import clr
clr.AddReference('ProtoGeometry')
from Autodesk.DesignScript.Geometry import *

clr.AddReference('System')
from System.Collections.Generic import List



#The inputs to this node will be stored as a list in the IN variables.
crvs = IN[0]

pts = List[Point]()


pts.Add(crvs.PointAtParameter(0.5))
pts.Add(crvs.PointAtParameter(0.8))

split = crvs.SplitByPoints(pts)



#Assign your output to the OUT variable.
OUT = split
# ----------------------------------------
python_script_2 = Python(IN[0]=flatten)
# ---------- python_script_2.python (28 lines) ----------
import clr
clr.AddReference('ProtoGeometry')
from Autodesk.DesignScript.Geometry import *

clr.AddReference('System')
from System.Collections.Generic import List
#The inputs to this node will be stored as a list in the IN variables.
crvs = IN[0]

pts = List[Point]()

for c in crvs:
	pts.Add(c.PointAtParameter(0))
	pts.Add(c.PointAtParameter(1))

lines = []

for c in crvs:
	if c.DistanceTo(pts[0])<0.1:
		lines.append(c.SplitByPoints(pts))

dist = []

for p,c in (pts,crvs):
	dist.append(c.DistanceTo(p))

#Assign your output to the OUT variable.
OUT = dist
# ----------------------------------------
type = Object.Type(python_script_2)
