# Dynamo graph SortCurves03.dyn (Dynamo 1.3.1.1736)

select_model_elements = DSModelElementsSelection()
curves = Element.Curves(select_model_elements)
flatten = Flatten(curves)
intersectAll = Curve.IntersectAll(flatten)
splitByPoints = Curve.SplitByPoints(curve=flatten, points=intersectAll)
flatten_2 = Flatten(splitByPoints)
length = Curve.Length(flatten_2)
removeNulls = Lists.Manage.RemoveNulls(length)
removeItemAtIndex = List.RemoveItemAtIndex(list=flatten_2, indices=removeNulls.out1)
code_block = CodeBlock(a=removeNulls.out0) { a>1; }
filterByBoolMask = List.FilterByBoolMask(list=removeItemAtIndex, mask=code_block)
code_block_2 = CodeBlock { {0,1}; }
pointAtParameter = Curve.PointAtParameter(curve=filterByBoolMask.in, param=code_block_2, lacing=CrossProduct)
distanceTo = Geometry.DistanceTo(geometry=intersectAll, other=pointAtParameter, lacing=CrossProduct)
code_block_3 = CodeBlock(a=distanceTo) { a==0; }
countTrue = CountTrue(code_block_3, lacing=Longest)
length_2 = Curve.Length(filterByBoolMask.in)
