# Dynamo graph Split Columns01.dyn (Dynamo 0.8.2.2392)

code_block = CodeBlock { "Top Level"; }
levels = Levels("F03 - THIRD FLOOR")
setParameterByName = Element.SetParameterByName(parameterName=code_block, value=levels)
# note: Column
element_types = ElementTypes("Level")
all_elements_of_type = ElementsOfType(element_types)
# note: Floors
select_model_elements = DSModelElementsSelection()  # 4 picked in the model
code_block_2 = CodeBlock { "Level"; }
getParameterValueByName = Element.GetParameterValueByName(element=select_model_elements, parameterName=code_block_2)
setIntersection = SetIntersection(all_elements_of_type, getParameterValueByName)
count = Count(setIntersection)
python_script = Python()
# ---------- python_script.python (47 lines) ----------
#Copyright(c) 2016, Dimitar Venkov
# @5devene, dimitar.ven@gmail.com

import clr

clr.AddReference("RevitServices")
import RevitServices
from RevitServices.Persistence import DocumentManager
from RevitServices.Transactions import TransactionManager
doc = DocumentManager.Instance.CurrentDBDocument

clr.AddReference("RevitNodes")
import Revit
clr.ImportExtensions(Revit.Elements)
clr.ImportExtensions(Revit.GeometryConversion)

clr.AddReference("RevitAPI")
from Autodesk.Revit.DB import *

clr.AddReference("System")
from System.Collections.Generic import List as cList

elements = UnwrapElement(IN[0])

level = UnwrapElement(IN[1])

"""
for el,v in zip(elements,level):
	el.SetParameterByName("Top Level", v)
"""
LevelPara = []

#toplvl = elements[0].get_Parameter(BuiltInParameter.FAMILY_INSTANCE_TOP_LEVEL_PARAM)
TransactionManager.Instance.EnsureInTransaction(doc)


toplvl = elements.get_Parameter("Top Level")

toplvl.Set(level.Id)

TransactionManager.Instance.TransactionTaskDone()
"""
for el,v in zip(elements,level):
	param = el.get_Parameter("Top Level")
	LevelPara.append(param.Set(v))
"""
OUT = toplvl
# ----------------------------------------
select_model_element = DSModelElementSelection()
class_ = Custom[Object.Class](obj=levels)  # Gets the input object's class name. Can process lists.
levels_2 = Levels("B01 - TOP SLAB.")
code_block_3 = CodeBlock { Vector.ByCoordinates(0,0,0); }
# note: Number of Columns
code_block_4 = CodeBlock { 3; }
cycle = List.Cycle(list=code_block_3, amount=code_block_4)

# group: copy
python_script_2 = Python(IN[1]=cycle)
# ---------- python_script_2.python (61 lines) ----------
#Copyright(c) 2016, Dimitar Venkov
# @5devene, dimitar.ven@gmail.com

import clr

clr.AddReference("RevitServices")
import RevitServices
from RevitServices.Persistence import DocumentManager
from RevitServices.Transactions import TransactionManager
doc = DocumentManager.Instance.CurrentDBDocument

clr.AddReference("RevitNodes")
import Revit
clr.ImportExtensions(Revit.Elements)
clr.ImportExtensions(Revit.GeometryConversion)

clr.AddReference("RevitAPI")
from Autodesk.Revit.DB import *

clr.AddReference("System")
from System.Collections.Generic import List as cList

def tolist(obj1):
	if hasattr(obj1,"__iter__"): return obj1
	else: return [obj1]

def output1(l1):
	if len(l1) == 1: return l1[0]
	else: return l1

elements = UnwrapElement(tolist(IN[0]))
vecs = tolist(IN[1])

oldId = []

for i in xrange(len(elements)):
	try: oldId.append(elements[i].Id)
	except: pass
	
oldId1 = cList[ElementId](oldId)

transforms = []
for i in xrange(len(vecs)):
	try: transforms.append(vecs[i].ToXyz(True))
	except: pass
	
def CopyEls(oldId1, transforms):
	out1 = []
	for i in xrange(len(transforms)):
		try:
			newId = ElementTransformUtils.CopyElements(doc, oldId1, transforms[i])
			if len(newId) == 1 :
				out1.append(doc.GetElement(newId[0]).ToDSType(False))
			else:
				[out1.append(doc.GetElement(newId[i]).ToDSType(False)) for i in xrange(len(newId))]
		except: out1.append([])
	return out1
	
TransactionManager.Instance.EnsureInTransaction(doc)
OUT = output1(CopyEls(oldId1, transforms))
TransactionManager.Instance.TransactionTaskDone()
# ----------------------------------------

create = List.Create(arg1=python_script_2)
addItemToFront = List.AddItemToFront(list=python_script_2)
select_model_elements_2 = DSModelElementsSelection()  # 3 picked in the model
python_script_3 = Python(IN[0]=select_model_elements_2, IN[1]=cycle)
# ---------- python_script_3.python (63 lines) ----------
#Copyright(c) 2016, Dimitar Venkov
# @5devene, dimitar.ven@gmail.com

import clr

clr.AddReference("RevitServices")
import RevitServices
from RevitServices.Persistence import DocumentManager
from RevitServices.Transactions import TransactionManager
doc = DocumentManager.Instance.CurrentDBDocument

clr.AddReference("RevitNodes")
import Revit
clr.ImportExtensions(Revit.Elements)
clr.ImportExtensions(Revit.GeometryConversion)

clr.AddReference("RevitAPI")
from Autodesk.Revit.DB import *

clr.AddReference("System")
from System.Collections.Generic import List as cList

def tolist(obj1):
	if hasattr(obj1,"__iter__"): return obj1
	else: return [obj1]
	
elements = UnwrapElement(tolist(IN[0]))

vecs = tolist(IN[1])

oldId = []

for i in xrange(len(elements)):
	try: oldId.append(elements[i].Id)
	except: pass
	
oldId1 = cList[ElementId](oldId)

transforms = []
for i in xrange(len(vecs)):
	try: transforms.append(vecs[i].ToXyz(True))
	except: pass
	
def CopyEls(oldId1, transforms):
	out1 = []
	for i in xrange(len(transforms)):
		try:
			newId = ElementTransformUtils.CopyElements(doc, oldId1, transforms[i])
			if len(newId) == 1 :
				out1.append(doc.GetElement(newId[0]).ToDSType(False))
			else:
				[out1.append(doc.GetElement(newId[i]).ToDSType(False)) for i in xrange(len(newId))]
		except: out1.append([])
	return out1
	
TransactionManager.Instance.EnsureInTransaction(doc)

copied = CopyEls(oldId1, transforms)


TransactionManager.Instance.TransactionTaskDone()

OUT = copied
# ----------------------------------------
flatten = Flatten(python_script_3)
chop = List.Chop(flatten, code_block_4)
levels_3 = Levels("F02 - SECOND FLOOR")
levels_4 = Levels("F03 - THIRD FLOOR")
levels_5 = Levels("F04 - ROOF FLOOR")
# note: Top Level
create_2 = List.Create(levels_3, levels_4, levels_5)
levels_6 = Levels("L01 - FIRST FLOOR")
# note: Base Level
create_3 = List.Create(levels_6, levels_3, levels_4)
python_script_4 = Python(IN[0]=chop, IN[1]=create_2, IN[2]=create_3)
# ---------- python_script_4.python (96 lines) ----------
#Copyright(c) 2016, Dimitar Venkov
# @5devene, dimitar.ven@gmail.com

import clr

clr.AddReference("RevitServices")
import RevitServices
from RevitServices.Persistence import DocumentManager
from RevitServices.Transactions import TransactionManager
doc = DocumentManager.Instance.CurrentDBDocument

clr.AddReference("RevitNodes")
import Revit
clr.ImportExtensions(Revit.Elements)
clr.ImportExtensions(Revit.GeometryConversion)

clr.AddReference("RevitAPI")
from Autodesk.Revit.DB import *

clr.AddReference("System")
from System.Collections.Generic import List as cList


elements = UnwrapElement(IN[0])

level = UnwrapElement(IN[1])

bslevel = UnwrapElement(IN[2])

	
TransactionManager.Instance.EnsureInTransaction(doc)

for i in range(0,len(elements)):
	for j in range (0,len(elements[i])):
		for k in range(0,len(level)):
			toplvl = elements[i][j].get_Parameter("Top Level")
			toplvl.Set(level[k].Id)
			baselvl = elements[i][j].get_Parameter("Base Level")
			baselvl.Set(bslevel[k].Id)

"""
for i in range(0,len(elements)):
	for j in range (0,len(elements[i])):
		for k in range(0,len(level)):
			toplvl = elements[i][j].get_Parameter("Top Level")
			toplvl.Set(level[0].Id)
			baselvl = elements[i][j].get_Parameter("Base Level")
			baselvl.Set(bslevel[0].Id)
			toplvl.Set(level[1].Id)
			baselvl = elements[i][j].get_Parameter("Base Level")
			baselvl.Set(bslevel[1].Id)
			toplvl.Set(level[2].Id)
			baselvl = elements[i][j].get_Parameter("Base Level")
			baselvl.Set(bslevel[2].Id)



toplvl = []

baselvl = []

for i in range(0,len(elements)):
	for j in range (0,len(elements[i])):
			toplvl.append(elements[i][j].get_Parameter("Top Level"))

for i in range(0,len(elements)):
	for j in range (0,len(elements[i])):
			baselvl.append(elements[i][j].get_Parameter("Base Level"))

for i in range(0,len(toplvl)):
	for j in range(0,len(level)):
		toplvl[i].Set(v.Id)
	
for b,z in zip(baselvl,bslevel):
	b.Set(z.Id)
"""


"""
for i in range(0,len(elements)):
	for j in range (0,len(elements[i])):				
		baselvl = elements[i][j].get_Parameter("Base Level")
		for z in range(0,len(bslevel)):
			baselvl.Set(bslevel[z].Id)
			
"""			

"""
for el,v in zip(elements,level):
	param = el.get_Parameter("Top Level")
	LevelPara.append(param.Set(v))
"""

TransactionManager.Instance.TransactionTaskDone()

OUT = toplvl
# ----------------------------------------
python_script_5 = Python(IN[0]=chop)
# ---------- python_script_5.python (30 lines) ----------
#Copyright(c) 2016, Dimitar Venkov
# @5devene, dimitar.ven@gmail.com

import clr

clr.AddReference("RevitServices")
import RevitServices
from RevitServices.Persistence import DocumentManager
from RevitServices.Transactions import TransactionManager
doc = DocumentManager.Instance.CurrentDBDocument

clr.AddReference("RevitNodes")
import Revit
clr.ImportExtensions(Revit.Elements)
clr.ImportExtensions(Revit.GeometryConversion)

clr.AddReference("RevitAPI")
from Autodesk.Revit.DB import *

clr.AddReference("System")
from System.Collections.Generic import List as cList


elements = UnwrapElement(IN[0])
ilist = []
for i in range(0,len(elements)):
	for j in range(0,len(elements[i])):
		ilist.append(j)
	
OUT = ilist
# ----------------------------------------
cycle_2 = List.Cycle(list=create_3, amount=code_block_4)
chop_2 = List.Chop(cycle_2, code_block_4)
cycle_3 = List.Cycle(list=create_2, amount=code_block_4)
chop_3 = List.Chop(cycle_3, code_block_4)
python_script_6 = Python(IN[0]=chop, IN[1]=create_2, IN[2]=create_3)
# ---------- python_script_6.python (82 lines) ----------
#Copyright(c) 2016, Dimitar Venkov
# @5devene, dimitar.ven@gmail.com

import clr

clr.AddReference("RevitServices")
import RevitServices
from RevitServices.Persistence import DocumentManager
from RevitServices.Transactions import TransactionManager
doc = DocumentManager.Instance.CurrentDBDocument

clr.AddReference("RevitNodes")
import Revit
clr.ImportExtensions(Revit.Elements)
clr.ImportExtensions(Revit.GeometryConversion)

clr.AddReference("RevitAPI")
from Autodesk.Revit.DB import *

clr.AddReference("System")
from System.Collections.Generic import List as cList


elements = UnwrapElement(IN[0])

level = UnwrapElement(IN[1])

bslevel = UnwrapElement(IN[2])

	
TransactionManager.Instance.EnsureInTransaction(doc)


def tolist(obj1):
	if hasattr(obj1,"__iter__"): return obj1
	else: return [obj1]
	
elements = UnwrapElement(tolist(IN[0]))

vecs = tolist(IN[1])

oldId = []

for i in xrange(len(elements)):
	try: oldId.append(elements[i].Id)
	except: pass
	
oldId1 = cList[ElementId](oldId)

transforms = []
for i in xrange(len(vecs)):
	try: transforms.append(vecs[i].ToXyz(True))
	except: pass
	
def CopyEls(oldId1, transforms):
	out1 = []
	for i in xrange(len(transforms)):
		try:
			newId = ElementTransformUtils.CopyElements(doc, oldId1, transforms[i])
			if len(newId) == 1 :
				out1.append(doc.GetElement(newId[0]).ToDSType(False))
			else:
				[out1.append(doc.GetElement(newId[i]).ToDSType(False)) for i in xrange(len(newId))]
		except: out1.append([])
	return out1
	
TransactionManager.Instance.EnsureInTransaction(doc)

copied = CopyEls(oldId1, transforms)


for i in range(0,len(elements)):
	for j in range (0,len(elements[i])):
		for k in range(0,len(level)):
			toplvl = elements[i][j].get_Parameter("Top Level")
			toplvl.Set(level[k].Id)
			baselvl = elements[i][j].get_Parameter("Base Level")
			baselvl.Set(bslevel[k].Id)

TransactionManager.Instance.TransactionTaskDone()

OUT = toplvl
# ----------------------------------------
select_model_element_2 = DSModelElementSelection()  # 1 picked in the model
flatten_2 = Flatten(select_model_element_2)
n1_column = Python(IN[0]=flatten_2, IN[1]=create_2, IN[2]=create_3)  # "1 column"
# ---------- n1_column.python (46 lines) ----------
#Copyright(c) 2016, Dimitar Venkov
# @5devene, dimitar.ven@gmail.com

import clr

clr.AddReference("RevitServices")
import RevitServices
from RevitServices.Persistence import DocumentManager
from RevitServices.Transactions import TransactionManager
doc = DocumentManager.Instance.CurrentDBDocument

clr.AddReference("RevitNodes")
import Revit
clr.ImportExtensions(Revit.Elements)
clr.ImportExtensions(Revit.GeometryConversion)

clr.AddReference("RevitAPI")
from Autodesk.Revit.DB import *

clr.AddReference("System")
from System.Collections.Generic import List as cList

elements = UnwrapElement(IN[0])

level = UnwrapElement(IN[1])

bslevel = UnwrapElement(IN[2])

LevelPara = []

#toplvl = elements[0].get_Parameter(BuiltInParameter.FAMILY_INSTANCE_TOP_LEVEL_PARAM)
TransactionManager.Instance.EnsureInTransaction(doc)

for el,v,z in zip(elements,level,bslevel):
	toplvl = el.get_Parameter("Top Level")
	toplvl.Set(v.Id)
	baselvl = el.get_Parameter("Base Level")
	baselvl.Set(z.Id)

TransactionManager.Instance.TransactionTaskDone()
"""
for el,v in zip(elements,level):
	param = el.get_Parameter("Top Level")
	LevelPara.append(param.Set(v))
"""
OUT = toplvl
# ----------------------------------------
