# Dynamo graph Create Callout.01dyn.dyn (Dynamo 1.2.0.2514)

select_model_element = DSModelElementSelection()  # 1 picked in the model
boundingBox = Geometry.BoundingBox(select_model_element)
minPoint = BoundingBox.MinPoint(boundingBox)
maxPoint = BoundingBox.MaxPoint(boundingBox)
element_types = ElementTypes("ViewFamilyType")
all_elements_of_type = ElementsOfType(element_types)
code_block = CodeBlock { "Reference Label"; }
parameterExists = Custom[Element.ParameterExists](param=code_block)  # Checks if an element contains a parameter of a given name; unwired: element
filter = List.Filter(all_elements_of_type, parameterExists)
getParameterValueByName = Element.GetParameterValueByName(element=filter, parameterName=code_block)
code_block_2 = CodeBlock { "dynamo"; }
code_block_3 = CodeBlock(reflabel=getParameterValueByName, search=code_block_2) { reflabel == search; }
filterByBoolMask = List.FilterByBoolMask(list=filter, mask=code_block_3)
code_block_4 = CodeBlock { "View Name"; }
code_block_5 = CodeBlock { "gio2"; }
setParameterByName = Element.SetParameterByName(parameterName=code_block_4, value=code_block_5)  # unwired: element
boundingBox_2 = Geometry.BoundingBox()  # unwired: arg0
views = Views("01")
name = Element.Name(all_elements_of_type)
code_block_6 = CodeBlock { "70 - Sh - G.A. Plan (Colour by Slab Level)"; }
contains = String.Contains(str=name, searchFor=code_block_6)
filterByBoolMask_2 = List.FilterByBoolMask(list=all_elements_of_type, mask=contains)
element_types_2 = ElementTypes("StairsRun")
all_elements_of_type_2 = ElementsOfType(element_types_2)
geometry = Element.Geometry(all_elements_of_type_2)
byGeometry = BoundingBox.ByGeometry(geometry)
minPoint_2 = BoundingBox.MinPoint(byGeometry)
maxPoint_2 = BoundingBox.MaxPoint(byGeometry)
deconstructPoint = Geometry.Points.DeconstructPoint(maxPoint_2)
deconstructPoint_2 = Geometry.Points.DeconstructPoint(minPoint_2)
byCoordinates = Point.ByCoordinates(x=deconstructPoint.out0, y=deconstructPoint.out1, z=deconstructPoint_2.out2)
byTwoPoints = Vector.ByTwoPoints(start=minPoint_2, end=byCoordinates)
ZAxis = Vector.ZAxis()
byCorners = Cuboid.ByCorners(lowPoint=minPoint_2, highPoint=maxPoint_2)
width = Cuboid.Width(byCorners)
length = Cuboid.Length(byCorners)
code_block_7 = CodeBlock(a=width, b=length) { a/b; }
atan = Math.Atan(code_block_7)
code_block_8 = CodeBlock(a=atan) { -(90-a); }
rotate = Vector.Rotate(byTwoPoints, ZAxis, code_block_8)
byStartPointDirectionLength = Line.ByStartPointDirectionLength(startPoint=minPoint_2, direction=rotate, length=width)
code_block_9 = CodeBlock(a=length) { a/2; }
translate = Geometry.Translate(geometry=byStartPointDirectionLength, yTranslation=code_block_9)
code_block_10 = CodeBlock(a=translate) { a[0]; }

# group: INPUT VALUES
flatten = Flatten(code_block_10)
# note: X defines the length direction of the section view
code_block_11 = CodeBlock { X vector; }
# note: Y defines the width direction of the section view
code_block_12 = CodeBlock { Y vector; }
code_block_13 = CodeBlock { ViewDepth:double; }  # unwired: ViewDepth
geometry_2 = Element.Geometry(code_block_10)
code_block_14 = CodeBlock { Revit Elements; }
# note: Distance between object countours and section crop region
code_block_15 = CodeBlock { CropRegionOffset:double; }  # unwired: CropRegionOffset
code_block_16 = CodeBlock { Viewname; }  # unwired: Viewname

code_block_17 = CodeBlock { 0.5; }
pointAtParameter = Curve.PointAtParameter(curve=code_block_10, param=code_block_17)

# group: APPLY CS AND WORKPLANE
# note: Generate a plane at the solid center which is orientated to the view cs. This plane is used to detect the boundaries of the section view.
byOriginXAxisYAxis = Plane.ByOriginXAxisYAxis(pointAtParameter, lacing=Longest)
# note: Defines the coordinate system for the direction of the section view.
# This is taken in the centroid of the solid geometry to be able to define negative and positive values for the min/max point
# Top view:
# X=length axis element
# Y=normal at length axis
# Front view:
# X=length axis element
# Y=Global Z axis
# Cross section view:
# X=normal axis element
# Y=Global Z axis
byOriginVectors = CoordinateSystem.ByOriginVectors(origin=pointAtParameter, lacing=Longest)
centroid = Solid.Centroid(flatten)

# group: DETECT SECTION BOUNDARY CURVES AND WORKPOINTS
intersect = Geometry.Intersect(geometry=flatten, other=byOriginXAxisYAxis, lacing=Longest)
flatten_2 = Flatten(intersect)
startPoint = Curve.StartPoint(flatten_2)
# note: Detect the perimeter curves of the cutting surface at the solid centroid
perimeterCurves = Surface.PerimeterCurves(flatten_2)
# note: Apply the offset on the cutting surface perimeter curves.
byJoinedCurves = PolyCurve.ByJoinedCurves(perimeterCurves)
code_block_18 = CodeBlock(x=code_block_15) { {x,-x}; }
offset = Curve.Offset(curve=byJoinedCurves, distance=code_block_18, lacing=CrossProduct)
isNull = Object.IsNull(offset)
# note: If the offset value exceeds the half-width of the surface, then it generates a "null" value for the generated polycurve.
# This might return an error in the Curve.Offset node. To filter out the "null" values, the List.FilterByBoolMask is used.
filterByBoolMask_3 = List.FilterByBoolMask(list=offset, mask=isNull)
length_2 = Curve.Length()  # unwired: arg0
# note: Get the external polycurve of the offsetted polycurves.
maximumItemByKey = MaximumItemByKey(arg1=length_2)  # unwired: arg0
# note: Get the single curves and their starting point to define the min and max boundary values
map = List.Map(list=byJoinedCurves, f_x=maximumItemByKey)
explode = Geometry.Explode(map)

# group: TRANSLATE TO WCS FOR minPoint / maxPoint Calc
identity = CoordinateSystem.Identity()
transform = Geometry.Transform(contextCoordinateSystem=identity)  # unwired: geometry, fromCoordinateSystem
# note: As Point.X and Point.Y only work according to global WCS, the curves are transformed from the solid.centroid to the WCS in order to define the MinPoint and MaxPoint of the cut surface (offset values already included)
combine = List.Combine(transform, startPoint, byOriginVectors)
Y = Point.Y(combine)
maximumItem = List.MaximumItem(Y)
X = Point.X(combine)
minimumItem = List.MinimumItem(X)
maximumItem_2 = List.MaximumItem(X)
minimumItem_2 = List.MinimumItem(Y)

code_block_19 = CodeBlock { 5000; }
code_block_20 = CodeBlock { 1000; }

# group: CREATE SECTION VIEW ACCORDING BOUNDING BOX
code_block_21 = CodeBlock(CropRegionOffset=code_block_19, ViewDepth=code_block_20)
# ---------- code_block_21.designscript (7 lines) ----------
//Z value calculation
//in accordance with the
//Centroid point
//Startingpoint of sectionview
-CropRegionOffset;
//Relative depth of sectionview
ViewDepth-CropRegionOffset;
# ----------------------------------------
byCoordinates_2 = Point.ByCoordinates(x=maximumItem, y=minimumItem, z=code_block_21.out0)
# note: The section view is created according the CS, defined by the centroid and the given section view direction.
# The minPoint / maxPoint is defined by the local oriented bounding box + offset of the element.
byCoordinates_3 = Point.ByCoordinates(x=maximumItem_2, y=maximumItem, z=code_block_21.out1)

# note: Parent View
python_script = Python(IN[0]=views, IN[1]=filterByBoolMask_2.in, IN[2]=byCoordinates_2, IN[3]=byCoordinates_3)
# ---------- python_script.python (41 lines) ----------
#Put view on sheet
import clr
clr.AddReference('RevitAPI')
from Autodesk.Revit.DB import *

clr.AddReference("RevitNodes")
import Revit
clr.ImportExtensions(Revit.Elements)

clr.AddReference("RevitServices")
import RevitServices
from RevitServices.Persistence import DocumentManager
from RevitServices.Transactions import TransactionManager

import clr
clr.AddReference('ProtoGeometry')

from Autodesk.DesignScript.Geometry import *

doc = DocumentManager.Instance.CurrentDBDocument

pView = UnwrapElement(IN[0])

FamType = UnwrapElement(IN[1])	

pt1 = UnwrapElement(IN[2])	

pt2 = UnwrapElement(IN[3])	


TransactionManager.Instance.EnsureInTransaction(doc) # you need an active transaction as you will create elements

vport=[]

view = ViewSection.CreateCallout(doc, pView.Id, FamType[0].Id, XYZ(pt1.X,pt1.Y,pt1.Z), XYZ(pt2.X,pt2.Y,pt2.Z))

	
TransactionManager.Instance.TransactionTaskDone()		


OUT = view
# ----------------------------------------
boundingBox_3 = Element.BoundingBox(python_script)
geometry_3 = Element.Geometry(select_model_element)
# note: Callout Family View
# note: BB Pt1
# note: BB Pt2
code_block_22 = CodeBlock { a[0]; }  # unwired: a
code_block_23 = CodeBlock { b[0]; }  # unwired: b
