# Dynamo graph RMP Label Stair Components 01.dyn (Dynamo 0.8.2.2392)

# group: COMMENTS
# note: Script Usage: Tag Components of Stairs by filling in Comments and Marks from stair to runs and supports
# Dynamo Version: 0.8.2.2392
# Author: Omar Kharodia

# group: SELECT STAIRS AND EXTRACT COMMENTS AND MARK PARAMETERS
element_types = ElementTypes("Stairs")
all_elements_of_type = ElementsOfType(element_types)
watch = Watch(all_elements_of_type)
id = Element.Id(all_elements_of_type)
code_block = CodeBlock { "Comments"; }
getParameterValueByName = Element.GetParameterValueByName(element=all_elements_of_type, parameterName=code_block)
code_block_2 = CodeBlock { "Mark"; }
getParameterValueByName_2 = Element.GetParameterValueByName(element=all_elements_of_type, parameterName=code_block_2)

# group: SELECT RUNS
element_types_2 = ElementTypes("StairsRun")
all_elements_of_type_2 = ElementsOfType(element_types_2)
watch_2 = Watch(all_elements_of_type_2)

# group: ASSUMING THAT RUNS IDs ARE STAIRS IDs+1
code_block_3 = CodeBlock(a=id) { a+1; }
id_2 = Element.Id(all_elements_of_type_2)
eq = code_block_3 == id_2  # lacing=CrossProduct
code_block_4 = CodeBlock { true; }
indexOf = IndexOf(eq, code_block_4, lacing=Longest)
code_block_5 = CodeBlock { -1; }
eq_2 = indexOf == code_block_5
filterByBoolMask = List.FilterByBoolMask(list=indexOf, mask=eq_2)
filterByBoolMask_2 = List.FilterByBoolMask(list=getParameterValueByName_2, mask=eq_2)

# group: SET RUNS PARAMETERS
getItemAtIndex = List.GetItemAtIndex(list=all_elements_of_type_2, index=filterByBoolMask.out)
code_block_6 = CodeBlock { "Comments"; }
filterByBoolMask_3 = List.FilterByBoolMask(list=getParameterValueByName, mask=eq_2)
setParameterByName = Element.SetParameterByName(element=getItemAtIndex, parameterName=code_block_6, value=filterByBoolMask_3.out)
code_block_7 = CodeBlock { "Mark"; }
setParameterByName_2 = Element.SetParameterByName(element=getItemAtIndex, parameterName=code_block_7, value=filterByBoolMask_2.out)

python_script = Python()
# ---------- python_script.python (29 lines) ----------
import clr
clr.AddReference('RevitAPI')
from Autodesk.Revit.DB import *

clr.AddReference("RevitNodes")
import Revit
clr.ImportExtensions(Revit.Elements)

clr.AddReference("RevitServices")
import RevitServices
from RevitServices.Persistence import DocumentManager

doc = DocumentManager.Instance.CurrentDBDocument
ids = UnwrapElement(IN[0])

elementlist = list()
unmatched = list()
elemIds = []

for i in ids:
	try:
		idInt = int(i) # assign i as integer to idInt
		elemId = Autodesk.Revit.DB.ElementId(idInt) # create an element Id from integer
		elemIds.append(elemId)
		elementlist.append(doc.GetElement(elemId).ToDSType(True)) # append the selected element to a list called elements
	except:
		unmatched.append(i)
		
OUT = (elemIds, elementlist, unmatched)
# ----------------------------------------
python_script_2 = Python()
# ---------- python_script_2.python (78 lines) ----------
# Copyright(c) 2016, Konrad Sobon
# @arch_laboratory, http://archi-lab.net

# Import ToDSType(bool) extension method
import clr
clr.AddReference("RevitNodes")
import Revit
clr.ImportExtensions(Revit.Elements)

# Import DocumentManager and TransactionManager
clr.AddReference("RevitServices")
import RevitServices
from RevitServices.Persistence import DocumentManager
doc = DocumentManager.Instance.CurrentDBDocument

# Import RevitAPI
clr.AddReference("RevitAPI")
import Autodesk
from Autodesk.Revit.DB import *

import sys
pyt_path = r'C:\Program Files (x86)\IronPython 2.7\Lib'
sys.path.append(pyt_path)

from System.Collections.Generic import *

#The inputs to this node will be stored as a list in the IN variable.
dataEnteringNode = IN

def ProcessList(_func, _list):
    return map( lambda x: ProcessList(_func, x) if type(x)==list else _func(x), _list )

def Unwrap(item):
	return UnwrapElement(item)

def ToRevitId(_id):
	if isinstance(_id, int):
		id = ElementId(int(_id))
		return ("ElementId", id)
	elif isinstance(_id, basestring) and len(_id) > 8:
		return ("GUID", _id)
	elif isinstance(_id, basestring) and len(_id) < 8:
		id = ElementId(int(_id))
		return ("ElementId", id)
	elif isinstance(_id, Autodesk.Revit.DB.ElementId):
		return ("ElementId", _id)
	else:
		return None

def ProcessIds(_id):
	id = ToRevitId(_id)
	if id == None:
		return None
	elif id[0] == "ElementId":
		return doc.GetElement.Overloads[Autodesk.Revit.DB.ElementId](id[1]).ToDSType(True)
	else:
		return doc.GetElement.Overloads[str](id[1]).ToDSType(True)

#unwrap incoming information for use with API
if isinstance(IN[0], list):
	ids = ProcessList(Unwrap, IN[0])
else:
	ids = [Unwrap(IN[0])]
    
try:
	errorReport = None
	elements = []
	output = ProcessList(ProcessIds, ids)
except:
	# if error accurs anywhere in the process catch it
	import traceback
	errorReport = traceback.format_exc()

#Assign your output to the OUT variable
if errorReport == None:
	OUT = output
else:
	OUT = errorReport
# ----------------------------------------
python_script_3 = Python()
# ---------- python_script_3.python (14 lines) ----------
import clr
clr.AddReference('ProtoGeometry')
from Autodesk.DesignScript.Geometry import *
#The inputs to this node will be stored as a list in the IN variables.
lst = IN[0]

drop = []

for i in range (0,len(lst)):
	if lst[i] == -1:
		drop.append(lst.index(lst[i]))

#Assign your output to the OUT variable.
OUT = drop
# ----------------------------------------

# group: SELECT STRINGERS
python_script_4 = Python(IN[0]=all_elements_of_type)
# ---------- python_script_4.python (28 lines) ----------
import clr

# Import DocumentManager and TransactionManager
clr.AddReference("RevitServices")
import RevitServices
from RevitServices.Persistence import DocumentManager

# Import RevitAPI
clr.AddReference("RevitAPI")
import Autodesk
from Autodesk.Revit.DB import *

document = DocumentManager.Instance.CurrentDBDocument

collector = FilteredElementCollector(document)
stairs = collector.WhereElementIsNotElementType().OfCategory(BuiltInCategory.OST_StairsStringerCarriage)
#supportIds = stairs.GetStairsSupports()

typelist = list()

for item in stairs:
	try: 
		typelist.append(item.Document.GetElement(item.Id))
	except:
		typelist.append(list())


OUT = typelist
# ----------------------------------------

# group: ASSUMING THAT STRINGERS IDs ARE STAIRS IDs+4
code_block_8 = CodeBlock(a=id) { a+4; }
id_3 = Element.Id(python_script_4)
eq_3 = code_block_8 == id_3  # lacing=CrossProduct
code_block_9 = CodeBlock { true; }
indexOf_2 = IndexOf(eq_3, code_block_9, lacing=Longest)
code_block_10 = CodeBlock { -1; }
eq_4 = indexOf_2 == code_block_10
filterByBoolMask_4 = List.FilterByBoolMask(list=indexOf_2, mask=eq_4)

# group: ASSUMING THAT STRINGERS IDs ARE STAIRS IDs+3
code_block_11 = CodeBlock(a=id) { a+3; }
id_4 = Element.Id(python_script_4)
eq_5 = code_block_11 == id_4  # lacing=CrossProduct
code_block_12 = CodeBlock { true; }
indexOf_3 = IndexOf(eq_5, code_block_12, lacing=Longest)
code_block_13 = CodeBlock { -1; }
eq_6 = indexOf_3 == code_block_13
filterByBoolMask_5 = List.FilterByBoolMask(list=indexOf_3, mask=eq_6)

# group: SET STRINGERS PARAMETERS
getItemAtIndex_2 = List.GetItemAtIndex(list=python_script_4, index=filterByBoolMask_4.out)
code_block_14 = CodeBlock { "Mark"; }
filterByBoolMask_6 = List.FilterByBoolMask(list=getParameterValueByName_2, mask=eq_4)
setParameterByName_3 = Element.SetParameterByName(element=getItemAtIndex_2, parameterName=code_block_14, value=filterByBoolMask_6.out)
getItemAtIndex_3 = List.GetItemAtIndex(list=python_script_4, index=filterByBoolMask_5.out)
setParameterByName_4 = Element.SetParameterByName(element=getItemAtIndex_3, parameterName=code_block_14, value=filterByBoolMask_6.out)
code_block_15 = CodeBlock { "Comments"; }
filterByBoolMask_7 = List.FilterByBoolMask(list=getParameterValueByName, mask=eq_4)
setParameterByName_5 = Element.SetParameterByName(element=getItemAtIndex_2, parameterName=code_block_15, value=filterByBoolMask_7.out)
filterByBoolMask_8 = List.FilterByBoolMask(list=getParameterValueByName, mask=eq_4)
setParameterByName_6 = Element.SetParameterByName(element=getItemAtIndex_3, parameterName=code_block_15, value=filterByBoolMask_8.out)

select_model_element = DSModelElementSelection()
code_block_16 = CodeBlock { 1; }
getSurroundingElements = Custom[Tool.GetSurroundingElements](Element_s=all_elements_of_type, Element_s_to_check=all_elements_of_type_2, Tolerance=code_block_16)  # Get Surrounding Elements by Categories, group them as List. Tolerance distance available.
getSurroundingElements_2 = Custom[Tool.GetSurroundingElements](Element_s=all_elements_of_type, Element_s_to_check=python_script_4, Tolerance=code_block_16)
