# Dynamo graph RMP Label Stair Components 02.dyn (Dynamo 0.8.2.2392)

# group: COMMENTS
# note: Script Usage: Tag Components of Stairs by filling in Comments and Marks from stair to runs and supports
# Dynamo Version: 0.8.2.2392
# Author: Omar Kharodia

# group: SELECT STAIRS AND EXTRACT COMMENTS AND MARK PARAMETERS
element_types = ElementTypes("Stairs")
all_elements_of_type = ElementsOfType(element_types)
watch = Watch(all_elements_of_type)

# group: SELECT RUNS
element_types_2 = ElementTypes("StairsRun")
all_elements_of_type_2 = ElementsOfType(element_types_2)
watch_2 = Watch(all_elements_of_type_2)

code_block = CodeBlock { 1; }

# group: INTERSECT RUNS AND STAIRS
getSurroundingElements = Custom[Tool.GetSurroundingElements](Element_s=all_elements_of_type, Element_s_to_check=all_elements_of_type_2, Tolerance=code_block)  # Get Surrounding Elements by Categories, group them as List. Tolerance distance available.

# group: SET COMMENTS
restOfItems = List.RestOfItems(getSurroundingElements, lacing=Longest)
flatten = Flatten(restOfItems)
code_block_2 = CodeBlock { "Comments"; }
firstItem = List.FirstItem(getSurroundingElements, lacing=Longest)
getParameterValueByName = Element.GetParameterValueByName(element=firstItem, parameterName=code_block_2)
count = List.Count(restOfItems, lacing=Longest)
cycle = List.Cycle(list=getParameterValueByName, amount=count, lacing=Longest)
flatten_2 = Flatten(cycle)
setParameterByName = Element.SetParameterByName(element=flatten, parameterName=code_block_2, value=flatten_2)

# group: SET MARK
restOfItems_2 = List.RestOfItems(getSurroundingElements, lacing=Longest)
flatten_3 = Flatten(restOfItems_2)
code_block_3 = CodeBlock { "Mark"; }
getParameterValueByName_2 = Element.GetParameterValueByName(element=firstItem, parameterName=code_block_3)
count_2 = List.Count(restOfItems_2, lacing=Longest)
cycle_2 = List.Cycle(list=getParameterValueByName_2, amount=count_2, lacing=Longest)
flatten_4 = Flatten(cycle_2)
setParameterByName_2 = Element.SetParameterByName(element=flatten_3, parameterName=code_block_3, value=flatten_4)

# group: SELECT STRINGERS
python_script = Python(IN[0]=all_elements_of_type)
# ---------- python_script.python (28 lines) ----------
import clr

# Import DocumentManager and TransactionManager
clr.AddReference("RevitServices")
import RevitServices
from RevitServices.Persistence import DocumentManager

# Import RevitAPI
clr.AddReference("RevitAPI")
import Autodesk
from Autodesk.Revit.DB import *

document = DocumentManager.Instance.CurrentDBDocument

collector = FilteredElementCollector(document)
stairs = collector.WhereElementIsNotElementType().OfCategory(BuiltInCategory.OST_StairsStringerCarriage)
#supportIds = stairs.GetStairsSupports()

typelist = list()

for item in stairs:
	try: 
		typelist.append(item.Document.GetElement(item.Id))
	except:
		typelist.append(list())


OUT = typelist
# ----------------------------------------

# group: INTERSECT STRINGERS AND STAIRS
getSurroundingElements_2 = Custom[Tool.GetSurroundingElements](Element_s=all_elements_of_type, Element_s_to_check=python_script, Tolerance=code_block)

# group: SET MARKS
restOfItems_3 = List.RestOfItems(getSurroundingElements_2, lacing=Longest)
flatten_5 = Flatten(restOfItems_3)
code_block_4 = CodeBlock { "Comments"; }
firstItem_2 = List.FirstItem(getSurroundingElements_2, lacing=Longest)
getParameterValueByName_3 = Element.GetParameterValueByName(element=firstItem_2, parameterName=code_block_4)
count_3 = List.Count(restOfItems_3, lacing=Longest)
cycle_3 = List.Cycle(list=getParameterValueByName_3, amount=count_3, lacing=Longest)
flatten_6 = Flatten(cycle_3)
setParameterByName_3 = Element.SetParameterByName(element=flatten_5, parameterName=code_block_4, value=flatten_6)

# group: SET COMMENTS
restOfItems_4 = List.RestOfItems(getSurroundingElements_2, lacing=Longest)
flatten_7 = Flatten(restOfItems_4)
code_block_5 = CodeBlock { "Mark"; }
firstItem_3 = List.FirstItem(getSurroundingElements_2, lacing=Longest)
getParameterValueByName_4 = Element.GetParameterValueByName(element=firstItem_3, parameterName=code_block_5)
count_4 = List.Count(restOfItems_4, lacing=Longest)
cycle_4 = List.Cycle(list=getParameterValueByName_4, amount=count_4, lacing=Longest)
flatten_8 = Flatten(cycle_4)
setParameterByName_4 = Element.SetParameterByName(element=flatten_7, parameterName=code_block_5, value=flatten_8)
