# Dynamo graph Set View Range.dyn (Dynamo 1.2.0.2514)

levels = Levels("00")
create = List.Create(levels)
code_block = CodeBlock { 4; }
create_2 = List.Create(code_block)
levels_2 = Levels("00")
create_3 = List.Create(levels_2)
code_block_2 = CodeBlock { -2; }
create_4 = List.Create(code_block_2)
python_script = Python(IN[1]=create, IN[2]=create_2, IN[3]=create_3, IN[4]=create_4)  # unwired: IN[0]
# ---------- python_script.python (49 lines) ----------
import clr
clr.AddReference('RevitAPI')
from Autodesk.Revit.DB import*
clr.AddReference('RevitServices')
from RevitServices.Persistence import DocumentManager
from RevitServices.Transactions import TransactionManager

doc = DocumentManager.Instance.CurrentDBDocument


views = UnwrapElement(IN[0])
ltop = UnwrapElement(IN[1])
toffset = IN[2]
lbottom = UnwrapElement(IN[3])
boffset = IN[4]
count = 0

TransactionManager.Instance.EnsureInTransaction(doc)

for v,lt,tof,lb,bof in zip(views,ltop,toffset,lbottom,boffset):

	#getting the viewrange of the view
	viewrange = v.GetViewRange()

	#Setting top clip plane of the viewrange
	#	Setting level of topclip plane
	viewrange.SetLevelId(PlanViewPlane.TopClipPlane,lt.Id)
	#	setting offset of top clip plane
	viewrange.SetOffset(PlanViewPlane.TopClipPlane,tof)
	
	viewrange.SetOffset(PlanViewPlane.CutPlane, tof);
	
	viewrange.SetLevelId(PlanViewPlane.CutPlane, lbottom.Id)
	viewrange.SetOffset(PlanViewPlane.CutPlane, toffset)
	
	#Setting bottom clip plane of the viewrange
	#	Setting level of bottom clip plane
	viewrange.SetLevelId(PlanViewPlane.BottomClipPlane,lb.Id)
	#	setting offset of bottom clip plane
	viewrange.SetOffset(PlanViewPlane.BottomClipPlane,bof)


	#Applying the viewrange to the view
	v.SetViewRange(viewrange)
	count = count +1

TransactionManager.Instance.TransactionTaskDone()

OUT = '%d view ranges altered' %(count)
# ----------------------------------------
get_all_views = Custom[Get All Views]()  # This node will query all views in the model and return them based on category
create_5 = List.Create(get_all_views.Engineering_Plans)
active_view = Custom[Active View]()  # Selects the current document's active view. Supports more view types than the built-in option. Will be depreciated once the bult in node works with all plan types.
python_script_2 = Python(IN[0]=active_view, IN[1]=levels, IN[2]=code_block, IN[3]=levels_2, IN[4]=code_block_2)
# ---------- python_script_2.python (55 lines) ----------
import clr
clr.AddReference('RevitAPI')
from Autodesk.Revit.DB import*
clr.AddReference('RevitServices')
from RevitServices.Persistence import DocumentManager
from RevitServices.Transactions import TransactionManager

doc = DocumentManager.Instance.CurrentDBDocument


views = UnwrapElement(IN[0])
ltop = UnwrapElement(IN[1])
toffset = IN[2]
lbottom = UnwrapElement(IN[3])
boffset = IN[4]
count = 0



#for v,lt,tof,lb,bof in zip(views,ltop,toffset,lbottom,boffset):



#for v in views:
	#getting the viewrange of the view
viewrange = views[0].GetViewRange()
	#topClipPlane = v.GetLevelId(PlanViewPlane.TopClipPlane)
topClipPlane = views[0].GetViewRange().GetLevelId(PlanViewPlane.TopClipPlane)

	#Setting top clip plane of the viewrange
	#	Setting level of topclip plane
viewrange.SetLevelId(PlanViewPlane.TopClipPlane, ltop.Id)
#	setting offset of top clip plane
viewrange.SetOffset(PlanViewPlane.TopClipPlane,toffset)

viewrange.SetLevelId(PlanViewPlane.CutPlane, lbottom.Id)
viewrange.SetOffset(PlanViewPlane.CutPlane, toffset)
	#Setting bottom clip plane of the viewrange
	#	Setting level of bottom clip plane
viewrange.SetLevelId(PlanViewPlane.BottomClipPlane,lbottom.Id)
	#	setting offset of bottom clip plane
viewrange.SetOffset(PlanViewPlane.BottomClipPlane,boffset)

	
TransactionManager.Instance.EnsureInTransaction(doc)
	#Applying the viewrange to the view
views[0].SetViewRange(viewrange)
count = count +1


TransactionManager.Instance.TransactionTaskDone()

#OUT= viewrange, topClipPlane

OUT = '%d view ranges altered' %(count),ltop.Id
# ----------------------------------------
watch = Watch()  # unwired: arg0
contains = Custom[String.Contains]()  # This node takes a list of strings and checks if any string contains a matching string from filter input.; unwired: StringList, FilterList
code_block_3 = CodeBlock { 1; }
watch_2 = Watch(get_all_views.Engineering_Plans)
name = Element.Name(watch_2)
code_block_4 = CodeBlock { "01"; }
contains_2 = String.Contains(str=name, searchFor=code_block_4)
filterByBoolMask = List.FilterByBoolMask(list=watch_2, mask=contains_2)
watch_3 = Watch(filterByBoolMask.in)
code_block_5 = CodeBlock { 1; }
