# Dynamo graph Set View Range01.dyn (Dynamo 1.2.0.2514)

levels = Levels("01")
code_block = CodeBlock { 1; }
set_single_view = Python(IN[1]=levels, IN[2]=code_block, IN[3]=levels, IN[4]=code_block)  # unwired: IN[0]
# ---------- set_single_view.python (55 lines) ----------
import clr
clr.AddReference('RevitAPI')
from Autodesk.Revit.DB import*
clr.AddReference('RevitServices')
from RevitServices.Persistence import DocumentManager
from RevitServices.Transactions import TransactionManager

doc = DocumentManager.Instance.CurrentDBDocument


views = UnwrapElement(IN[0])
ltop = UnwrapElement(IN[1])
toffset = IN[2]
lbottom = UnwrapElement(IN[3])
boffset = IN[4]
count = 0



#for v,lt,tof,lb,bof in zip(views,ltop,toffset,lbottom,boffset):



#for v in views:
	#getting the viewrange of the view
viewrange = views[0].GetViewRange()
	#topClipPlane = v.GetLevelId(PlanViewPlane.TopClipPlane)
topClipPlane = views[0].GetViewRange().GetLevelId(PlanViewPlane.TopClipPlane)

	#Setting top clip plane of the viewrange
	#	Setting level of topclip plane
viewrange.SetLevelId(PlanViewPlane.TopClipPlane, ltop.Id)
#	setting offset of top clip plane
viewrange.SetOffset(PlanViewPlane.TopClipPlane,toffset)

viewrange.SetLevelId(PlanViewPlane.CutPlane, lbottom.Id)
viewrange.SetOffset(PlanViewPlane.CutPlane, toffset)
	#Setting bottom clip plane of the viewrange
	#	Setting level of bottom clip plane
viewrange.SetLevelId(PlanViewPlane.BottomClipPlane,lbottom.Id)
	#	setting offset of bottom clip plane
viewrange.SetOffset(PlanViewPlane.BottomClipPlane,boffset)

	
TransactionManager.Instance.EnsureInTransaction(doc)
	#Applying the viewrange to the view
views[0].SetViewRange(viewrange)
count = count +1


TransactionManager.Instance.TransactionTaskDone()

#OUT= viewrange, topClipPlane

OUT = '%d view ranges altered' %(count),ltop.Id
# ----------------------------------------
get_all_views = Custom[Get All Views]()  # This node will query all views in the model and return them based on category
name = Element.Name(get_all_views.Engineering_Plans)
code_block_2 = CodeBlock { "Level 00"; }
filterByString = Custom[List.FilterByString](list=name, String=code_block_2)  # Filter a list by a string match
filterByBoolMask = List.FilterByBoolMask(list=get_all_views.Engineering_Plans, mask=filterByString.Bool)
create = List.Create(filterByBoolMask.in)
levels_2 = Levels("01")
count = Count(filterByBoolMask.in)
cycle = List.Cycle(list=levels_2, amount=count)
code_block_3 = CodeBlock { 1; }
cycle_2 = List.Cycle(list=code_block_3, amount=count)
python_script = Python(IN[0]=filterByBoolMask.in, IN[1]=cycle, IN[2]=cycle_2, IN[3]=cycle, IN[4]=cycle_2)
# ---------- python_script.python (49 lines) ----------
import clr
clr.AddReference('RevitAPI')
from Autodesk.Revit.DB import*
clr.AddReference('RevitServices')
from RevitServices.Persistence import DocumentManager
from RevitServices.Transactions import TransactionManager

doc = DocumentManager.Instance.CurrentDBDocument


views = UnwrapElement(IN[0])
ltop = UnwrapElement(IN[1])
toffset = IN[2]
lbottom = UnwrapElement(IN[3])
boffset = IN[4]
count = 0

TransactionManager.Instance.EnsureInTransaction(doc)

for v,lt,tof,lb,bof in zip(views,ltop,toffset,lbottom,boffset):

	#getting the viewrange of the view
	viewrange = v.GetViewRange()

	#Setting top clip plane of the viewrange
	#	Setting level of topclip plane
	viewrange.SetLevelId(PlanViewPlane.TopClipPlane,lt.Id)
	#	setting offset of top clip plane
	viewrange.SetOffset(PlanViewPlane.TopClipPlane,tof)
	
	viewrange.SetOffset(PlanViewPlane.CutPlane, tof);
	
	viewrange.SetLevelId(PlanViewPlane.CutPlane, lb.Id)
	viewrange.SetOffset(PlanViewPlane.CutPlane, tof)
	
	#Setting bottom clip plane of the viewrange
	#	Setting level of bottom clip plane
	viewrange.SetLevelId(PlanViewPlane.BottomClipPlane,lb.Id)
	#	setting offset of bottom clip plane
	viewrange.SetOffset(PlanViewPlane.BottomClipPlane,bof)


	#Applying the viewrange to the view
	v.SetViewRange(viewrange)
	count = count +1

TransactionManager.Instance.TransactionTaskDone()

OUT = '%d view ranges altered' %(count)
# ----------------------------------------
watch = Watch(filterByBoolMask.in)
active_view = Custom[Active View]()  # Selects the current document's active view. Supports more view types than the built-in option. Will be depreciated once the bult in node works with all plan types.
create_2 = List.Create(active_view)
