# Dynamo graph Stair Support.dyn (Dynamo 0.8.2.2392)

categories = Categories("Stairs")
all_elements_of_category = ElementsOfCategory(categories)
python_script = Python(IN[0]=all_elements_of_category)
# ---------- python_script.python (25 lines) ----------
import clr
clr.AddReference('RevitAPI')
from Autodesk.Revit.DB import *

clr.AddReference("RevitNodes")
import Revit
clr.ImportExtensions(Revit.Elements)

stairs = UnwrapElement(IN[0])
supportIds = []

for stair in stairs:
    supportIds.append(stair.GetStairsSupports())

substair = []

for i in range(0,len(supportIds)):
    sub = []
    substair.append(sub)
    for j in range(0,len(supportIds[i])):
        sub.append(stairs[i].Document.GetElement(supportIds[i][j]))



OUT = substair
# ----------------------------------------
