# Dynamo graph Stairs 05.dyn (Dynamo 1.2.0.2514)

# group: SECTIONS ON GRID
# note: CREATED BY: <SHAWNEE FINLAYSON>
# CREATED: <20160918>
# VERSION <V1>
# LAST EDITED: <20161006>
# DYNAMO VERSION: <Dynamo 1.0.0>
# PACKAGES:
# <ARCHILAB_GRIMSHAW>
# <Clockwork>
# NOTES:
# <NOTES>
# DYNAMO GRAPHIC STANDARD
# CREATED BY:

# group: DESIGNER'S GUIDELINES
# note: DESIGNER'S GUIDELINES
# 1. Select the Revit Grids that you would like sections of using the top "Select Model Elements" node.
# 2. Select the Revit line that you would like to cut a section along using the bottom "Select Model Elements" node.
# 3. Please note that you don't need to populate both the grids and line selections if you do not want sections along both types of elements.
# 4. Ensure that the string node at the end of this script is populated with the correct view template to apply to the views prior to running.
# 5. All script variables are shown in orange.

boolean = BoolSelector(true)
pick_model_elements = Custom[Pick Model Elements](refresh=boolean)  # This node offers a pick method for selecting elements in Revit.
geometry = Element.Geometry(pick_model_elements)
create = List.Create(geometry)
flatten = Flatten(create)
byUnion = Solid.ByUnion(flatten)
boundingBox = Geometry.BoundingBox(byUnion)
toCuboid = BoundingBox.ToCuboid(boundingBox)
centroid = Solid.Centroid(toCuboid)
ZAxis = Vector.ZAxis()
code_block = CodeBlock { 0; }
rotate = Geometry.Rotate(geometry=toCuboid, origin=centroid, axis=ZAxis, degrees=code_block)
vertices = Topology.Vertices(rotate)
pointGeometry = Vertex.PointGeometry(vertices)
boundingBox_2 = Geometry.BoundingBox(rotate)
minPoint = BoundingBox.MinPoint(boundingBox_2)
code_block_2 = CodeBlock(a=minPoint) { a.Z; }
code_block_3 = CodeBlock(a=pointGeometry, b=code_block_2) { a.Z==b; }
filterByBoolMask = List.FilterByBoolMask(list=pointGeometry, mask=code_block_3)
code_block_4 = CodeBlock { 1; }
byPoints = PolyCurve.ByPoints(points=filterByBoolMask.in, connectLastToFirst=code_block_4)
element_types = ElementTypes("StairsRun")
all_elements_of_type = ElementsOfType(element_types)
geometry_2 = Element.Geometry(all_elements_of_type)
byGeometry = BoundingBox.ByGeometry(geometry_2)
toCuboid_2 = BoundingBox.ToCuboid(byGeometry)
length = Cuboid.Length(toCuboid_2)
width = Cuboid.Width(toCuboid_2)
create_2 = List.Create(length, width)
flatten_2 = Flatten(create_2)
minimumItem = List.MinimumItem(flatten_2)
code_block_5 = CodeBlock { -1; }
mul = minimumItem * code_block_5
code_block_6 = CodeBlock { 2; }
div = mul / code_block_6
code_block_7 = CodeBlock { 0; }
offset = PolyCurve.Offset(byPoints, div, code_block_7)
explode = Geometry.Explode(offset)
length_2 = Curve.Length(explode)
uniqueItems = List.UniqueItems(length_2)
maximumItem = List.MaximumItem(uniqueItems)
code_block_8 = CodeBlock(a=length_2, b=maximumItem) { a==b; }
filterByBoolMask_2 = List.FilterByBoolMask(list=explode, mask=code_block_8)
flatten_3 = Flatten(filterByBoolMask_2.in)
removeNulls = Lists.Manage.RemoveNulls(flatten_3)

# group: Moves curves so they are centred on 0,0,0
code_block_9 = CodeBlock { 0.5; }
pointAtParameter = Curve.PointAtParameter(curve=removeNulls, param=code_block_9)
code_block_10 = CodeBlock { 0; 0; 0; }
byCoordinates = Point.ByCoordinates(x=code_block_10.out0, y=code_block_10.out1, z=code_block_10.out2)
byTwoPoints = Vector.ByTwoPoints(start=pointAtParameter, end=byCoordinates)
translate = Geometry.Translate(geometry=removeNulls, direction=byTwoPoints)
byTwoPoints_2 = Vector.ByTwoPoints(start=byCoordinates, end=pointAtParameter)

# group: Point in extreme bottom left corner
startPoint = Curve.StartPoint(translate)
endPoint = Curve.EndPoint(translate)
create_3 = List.Create(startPoint, endPoint)
flatten_4 = Flatten(create_3)
X = Point.X(flatten_4)
minimumItem_2 = List.MinimumItem(X)
Y = Point.Y(flatten_4)
minimumItem_3 = List.MinimumItem(Y)
create_4 = List.Create(minimumItem_2, minimumItem_3)
minimumItem_4 = List.MinimumItem(create_4)
byCoordinates_2 = Point.ByCoordinates(x=minimumItem_4, y=minimumItem_4)
code_block_11 = CodeBlock { Vector.XAxis(); -5000; }
translate_2 = Geometry.Translate(geometry=byCoordinates_2, direction=code_block_11.out0, distance=code_block_11.out1)
code_block_12 = CodeBlock { Vector.YAxis(); -5000; }
translate_3 = Geometry.Translate(geometry=translate_2, direction=code_block_12.out0, distance=code_block_12.out1)

# group: Organises start/end points into joined lists
code_block_13 = CodeBlock { 1; }
chop = List.Chop(list=startPoint, lengths=code_block_13)
chop_2 = List.Chop(list=endPoint, lengths=code_block_13)
code_block_14 = CodeBlock { 1; }
insert = Insert(chop, chop_2, code_block_14, lacing=Longest)
flatten_5 = Flatten(insert)
code_block_15 = CodeBlock { 2; }
chop_3 = List.Chop(list=flatten_5, lengths=code_block_15)

byStartPointEndPoint = Line.ByStartPointEndPoint(startPoint=translate_3, endPoint=flatten_5)

# group: Orientates curves so sections are facing the right way
chop_4 = List.Chop(list=byStartPointEndPoint, lengths=code_block_15)
length_3 = Curve.Length(chop_4)
code_block_16 = CodeBlock { 0; 1; }
getItemAtIndex = List.GetItemAtIndex(list=length_3, index=code_block_16.out0, lacing=Longest)
getItemAtIndex_2 = List.GetItemAtIndex(list=length_3, index=code_block_16.out1, lacing=Longest)
lt = getItemAtIndex < getItemAtIndex_2
code_block_17 = CodeBlock { 1; 0; }
if_ = If(test=lt, true=code_block_17.out0, false=code_block_17.out1)
getItemAtIndex_3 = List.GetItemAtIndex(list=chop_3, index=if_, lacing=Longest)
code_block_18 = CodeBlock { 0; 1; }
if_2 = If(test=lt, true=code_block_18.out0, false=code_block_18.out1)
getItemAtIndex_4 = List.GetItemAtIndex(list=chop_3, index=if_2, lacing=Longest)

byStartPointEndPoint_2 = Line.ByStartPointEndPoint(startPoint=getItemAtIndex_3, endPoint=getItemAtIndex_4)

# group: Moves curves back to original position
translate_4 = Geometry.Translate(geometry=byStartPointEndPoint_2, direction=byTwoPoints_2)

# group: Moves Section Mark off Gridline
code_block_19 = CodeBlock { 0.5; }
normalAtParameter = Curve.NormalAtParameter(curve=translate_4, param=code_block_19)
code_block_20 = CodeBlock { 0; }
translate_5 = Geometry.Translate(geometry=translate_4, direction=normalAtParameter, distance=code_block_20)

# group: Creates the local coordinate system for each grid
pointAtParameter_2 = Curve.PointAtParameter(curve=translate_5, param=code_block_19)
startPoint_2 = Curve.StartPoint(translate_5)
endPoint_2 = Curve.EndPoint(translate_5)
byTwoPoints_3 = Vector.ByTwoPoints(start=startPoint_2, end=endPoint_2)
ZAxis_2 = Vector.ZAxis()
byOriginVectors = CoordinateSystem.ByOriginVectors(origin=pointAtParameter_2, xAxis=byTwoPoints_3, yAxis=ZAxis_2)

# group: Section Extension Length
extension_length = DoubleSlider(2000, range=0..2000 step 0.1)

code_block_21 = CodeBlock(a=code_block_2) { a-1000; }
maxPoint = BoundingBox.MaxPoint(boundingBox_2)
code_block_22 = CodeBlock(a=maxPoint) { a.Z; }
code_block_23 = CodeBlock(a=code_block_22) { a+1000; }

# group: View Depth
view_depth = DoubleSlider(500, range=0..500 step 0.1)

# group: Section View Dimensions in local coordinate system - Width (X) / ViewDepth (Z) / Height (Y)
length_4 = Curve.Length(translate_4)
code_block_24 = CodeBlock { 2; }
code_block_25 = CodeBlock { -1; }
code_block_26 = CodeBlock { 0; }

add = length_4 + extension_length

# group (continued): Section View Dimensions in local coordinate system - Width (X) / ViewDepth (Z) / Height (Y)
div_2 = add / code_block_24
mul_2 = div_2 * code_block_25
byCoordinates_3 = Point.ByCoordinates(x=mul_2, y=code_block_21, z=code_block_26)
byCoordinates_4 = Point.ByCoordinates(x=div_2, y=code_block_23, z=view_depth)

# group: Creates Sections in Revit
byCoordinateSystemMinPointMaxPoint = SectionView.ByCoordinateSystemMinPointMaxPoint(byOriginVectors, byCoordinates_3, byCoordinates_4)

# group: View Template that you want to apply to the views
string = StringInput("70 - Sh - G.A. Elevation (Full Height)")

applyViewTemplate = Custom[View.ApplyViewTemplate](Views=byCoordinateSystemMinPointMaxPoint, View_Template_Name=string)  # Applies a view template to any given view(s). Supply a string with a view template name.
all_elements_of_type_2 = ElementsOfType()  # unwired: arg0
element_types_2 = ElementTypes("StairsLanding")
views = Views("Wo - Level 00 - G.A. Site Plan")
element_types_3 = ElementTypes("ViewFamilyType")
all_elements_of_type_3 = ElementsOfType(element_types_3)
watch = Watch(all_elements_of_type_3)
name = Element.Name(watch)
code_block_27 = CodeBlock { "70 - Sh - G.A. Plan (Colour by Slab Level)"; }
contains = String.Contains(str=name, searchFor=code_block_27)
filterByBoolMask_3 = List.FilterByBoolMask(list=watch, mask=contains)
code_block_28 = CodeBlock(a=byCoordinates_3) { a[0]; }
code_block_29 = CodeBlock(b=byCoordinates_4) { b[0]; }
byCorners = BoundingBox.ByCorners(min=code_block_28, max=code_block_29)
minPoint_2 = BoundingBox.MinPoint(byCorners)
maxPoint_2 = BoundingBox.MaxPoint(byCorners)
python_script = Python(IN[0]=views, IN[1]=filterByBoolMask_3.in, IN[2]=minPoint_2, IN[3]=maxPoint_2)
# ---------- python_script.python (40 lines) ----------
#Put view on sheet
import clr
clr.AddReference('RevitAPI')
from Autodesk.Revit.DB import *

clr.AddReference("RevitNodes")
import Revit
clr.ImportExtensions(Revit.Elements)

clr.AddReference("RevitServices")
import RevitServices
from RevitServices.Persistence import DocumentManager
from RevitServices.Transactions import TransactionManager

import clr
clr.AddReference('ProtoGeometry')

from Autodesk.DesignScript.Geometry import *

doc = DocumentManager.Instance.CurrentDBDocument

pView = UnwrapElement(IN[0])

FamType = UnwrapElement(IN[1])	

pt1 = UnwrapElement(IN[2])	

pt2 = UnwrapElement(IN[3])	

TransactionManager.Instance.EnsureInTransaction(doc) # you need an active transaction as you will create elements

vport=[]

view = ViewSection.CreateCallout(doc, pView.Id, FamType[0].Id, XYZ(pt1.X,pt1.Y,pt1.Z), XYZ(pt2.X,pt2.Y,pt2.Z))


	
TransactionManager.Instance.TransactionTaskDone()		

OUT = view
# ----------------------------------------
# note: Top
code_block_30 = CodeBlock { 438; }
boolean_2 = BoolSelector(true)
active_view = Custom[Active View](refresh=boolean_2)
name_2 = Element.Name(active_view)
categories = Categories("Sheets")
all_elements_of_category = ElementsOfCategory(categories)
watch_2 = Watch(all_elements_of_category)
code_block_31 = CodeBlock { "Sheet Number"; }
getParameterValueByName = Element.GetParameterValueByName(element=watch_2, parameterName=code_block_31)
# note: 13.10.2016
# Dynamo 0.8
string_2 = StringInput("1000")
eq = getParameterValueByName == string_2  # lacing=CrossProduct
countTrue = CountTrue(eq, lacing=Longest)
code_block_32 = CodeBlock { 1; }
eq_2 = countTrue == code_block_32  # lacing=CrossProduct
flatten_6 = Flatten(eq_2)
filterByBoolMask_4 = List.FilterByBoolMask(list=watch_2, mask=flatten_6)
flatten_7 = Flatten(filterByBoolMask_4.in)

# group: Renames Section Views based on Grid Names
code_block_33 = CodeBlock { "View Scale"; }
code_block_34 = CodeBlock { 50; }
setParameterByName = Element.SetParameterByName(element=byCoordinateSystemMinPointMaxPoint, parameterName=code_block_33, value=code_block_34)

# note: Left
code_block_35 = CodeBlock { 188; }
# note: Right
code_block_36 = CodeBlock { 563; }
create_5 = List.Create(code_block_35, code_block_36)
code_block_37 = CodeBlock(a=create_5) { a/304; }
# note: Bottom
code_block_38 = CodeBlock { 219; }
create_6 = List.Create(code_block_38, code_block_38)
code_block_39 = CodeBlock(b=create_6) { b/304; }
# note: Sheet
# note: Pt x
# note: View
# note: Pt y
python_script_2 = Python(IN[0]=flatten_7, IN[1]=setParameterByName, IN[2]=code_block_37, IN[3]=code_block_39)
# ---------- python_script_2.python (74 lines) ----------
#Put view on sheet
import clr
clr.AddReference('RevitAPI')
from Autodesk.Revit.DB import *

clr.AddReference("RevitNodes")
import Revit
clr.ImportExtensions(Revit.Elements)

clr.AddReference("RevitServices")
import RevitServices
from RevitServices.Persistence import DocumentManager
from RevitServices.Transactions import TransactionManager

import clr
clr.AddReference('ProtoGeometry')

from Autodesk.DesignScript.Geometry import *

doc = DocumentManager.Instance.CurrentDBDocument

if isinstance(IN[0], list):
	sheets = []
	for i in IN[0]:
		sheets.append(UnwrapElement(i))
else:
	sheets = [UnwrapElement(IN[0])]
	
	
if isinstance(IN[1], list):
	views = []
	for i in IN[1]:
		views.append(UnwrapElement(i))
else:
	views = [UnwrapElement(IN[1])]


if isinstance(IN[2], list):
	ptx = []
	for i in IN[2]:
		ptx.append(float(UnwrapElement(i)))
else:
	ptx = [UnwrapElement(IN[2])]


if isinstance(IN[3], list):
	pty = []
	for i in IN[3]:
		pty.append(float(UnwrapElement(i)))
else:
	pty = [UnwrapElement(IN[3])]

pts=[]

for j,k in zip(ptx,pty):
	pts.append(Point.ByCoordinates(j,k))
	

TransactionManager.Instance.EnsureInTransaction(doc) # you need an active transaction as you will create elements

vport=[]

for i in views:
	vport.append(Viewport.Create(doc,sheets[0].Id,i.Id,XYZ.Zero))

for v,p in zip(vport,pts):
	v.SetBoxCenter(XYZ(p.X,p.Y,p.Z))
	
	
TransactionManager.Instance.TransactionTaskDone()		



OUT = pts
# ----------------------------------------
select_model_element = DSModelElementSelection()  # 1 picked in the model
select_model_element_2 = DSModelElementSelection()  # 1 picked in the model
element_types_4 = ElementTypes("StairsRun")
all_elements_of_type_4 = ElementsOfType(element_types_4)
code_block_40 = CodeBlock { 1; }
getSurroundingElements = Custom[Tool.GetSurroundingElements](Element=select_model_element_2, ElementCheck=all_elements_of_type_4, Tolerance=code_block_40)  # Get Surrounding Elements by Categories, group them as List. Tolerance distance available.
flatten_8 = Flatten(getSurroundingElements)
restOfItems = List.RestOfItems(flatten_8)
geometry_3 = Element.Geometry(restOfItems)
byGeometry_2 = BoundingBox.ByGeometry(geometry_3)
toCuboid_3 = BoundingBox.ToCuboid(byGeometry_2)
width_2 = Cuboid.Width(toCuboid_3)
length_5 = Cuboid.Length(toCuboid_3)
create_7 = List.Create(width_2, length_5)
flatten_9 = Flatten(create_7)
minimumItem_5 = List.MinimumItem(flatten_9)
code_block_41 = CodeBlock { 500; }
code_block_42 = CodeBlock { -500; }
python_script_3 = Python(IN[1]=code_block_41, IN[2]=code_block_41, IN[3]=code_block_42, IN[4]=code_block_42)  # unwired: IN[0]
# ---------- python_script_3.python (46 lines) ----------
import clr
clr.AddReference('RevitAPI')
from Autodesk.Revit.DB import*
clr.AddReference('RevitServices')
from RevitServices.Persistence import DocumentManager
from RevitServices.Transactions import TransactionManager

doc = DocumentManager.Instance.CurrentDBDocument


views = UnwrapElement(IN[0])
ltop = UnwrapElement(IN[1])
toffset = IN[2]
lbottom = UnwrapElement(IN[3])
boffset = IN[4]
count = 0

TransactionManager.Instance.EnsureInTransaction(doc)

for v,lt,tof,lb,bof in zip(views,ltop,toffset,lbottom,boffset):


	#getting the viewrange of the view
	viewrange = v.GetViewRange()

	#Setting top clip plane of the viewrange
	#	Setting level of topclip plane
	viewrange.SetLevelId(PlanViewPlane.TopClipPlane,lt.Id)
	#	setting offset of top clip plane
	viewrange.SetOffset(PlanViewPlane.TopClipPlane,tof)

	#Setting bottom clip plane of the viewrange
	#	Setting level of bottom clip plane
	viewrange.SetLevelId(PlanViewPlane.BottomClipPlane,lb.Id)
	#	setting offset of bottom clip plane
	viewrange.SetOffset(PlanViewPlane.BottomClipPlane,bof)


	#Applying the viewrange to the view
	v.SetViewRange(viewrange)
	count = count +1

TransactionManager.Instance.TransactionTaskDone()


OUT = '%d view ranges altered' %(count)
# ----------------------------------------
python_script_4 = Python(IN[0]=minPoint_2, IN[1]=maxPoint_2)
# ---------- python_script_4.python (36 lines) ----------
#Put view on sheet
import clr
clr.AddReference('RevitAPI')
from Autodesk.Revit.DB import *

clr.AddReference("RevitNodes")
import Revit
clr.ImportExtensions(Revit.Elements)

clr.AddReference("RevitServices")
import RevitServices
from RevitServices.Persistence import DocumentManager
from RevitServices.Transactions import TransactionManager

import clr
clr.AddReference('ProtoGeometry')

from Autodesk.DesignScript.Geometry import *

doc = DocumentManager.Instance.CurrentDBDocument

pt1 = UnwrapElement(IN[0])	

pt2 = UnwrapElement(IN[1])	

TransactionManager.Instance.EnsureInTransaction(doc) # you need an active transaction as you will create elements

vport=[]

view = XYZ(pt1.X,pt1.Y,pt1.Z), XYZ(pt2.X,pt2.Y,pt2.Z)


	
TransactionManager.Instance.TransactionTaskDone()		

OUT = view
# ----------------------------------------
