# Dynamo graph Stairs.dyn (Dynamo 1.2.0.2514)

select_model_element = DSModelElementSelection()  # 1 picked in the model
python_script = Python(IN[0]=select_model_element)
# ---------- python_script.python (73 lines) ----------
#Copyright(c) 2015, Konrad K Sobon
# @arch_laboratory, http://archi-lab.net

import clr
import sys
clr.AddReference('ProtoGeometry')
from Autodesk.DesignScript.Geometry import *

pyt_path = r'C:\Program Files (x86)\IronPython 2.7\Lib'
sys.path.append(pyt_path)

# Import Element wrapper extension methods
clr.AddReference("RevitNodes")
import Revit
clr.ImportExtensions(Revit.Elements)

# Import DocumentManager and TransactionManager
clr.AddReference("RevitServices")
import RevitServices
from RevitServices.Persistence import DocumentManager
from RevitServices.Transactions import TransactionManager

doc = DocumentManager.Instance.CurrentDBDocument
uiapp = DocumentManager.Instance.CurrentUIApplication
app = uiapp.Application

# Import RevitAPI
clr.AddReference("RevitAPI")
import Autodesk
from Autodesk.Revit.DB import *
import System

#The inputs to this node will be stored as a list in the IN variable.

items = UnwrapElement(IN[0])

itemsType = items.GetTypeId()

item = items.GetValidTypes()

itemName = []

run = []
	
TransactionManager.Instance.EnsureInTransaction(doc)

for it in item:
	t = doc.GetElement(it)
	itemName.append(t)
	
TransactionManager.Instance.TransactionTaskDone()
	
#run.append(t.get_Parameter(BuiltInParameter.STAIRS_RUN_HEIGHT))

OUT = itemName

#AssemblyCode = type.get_Parameter(BuiltInParameter.TEXT_SIZE).AsString()


#bipNumber = BuiltInParameter.TEXT_SIZE
 
#tempSheetNum = bipNumber.get_Parameter(bipNumber).AsString()
 
    
#textSizeParam = textType.get_Parameter(BuiltInParameter.TEXT_SIZE);

#paramTextUnderline = textType.get_Parameter(BuiltInParameter.TEXT_STYLE_UNDERLINE)

#paramTextUnderline = textType.get_Parameter("TEXT_STYLE_UNDERLINE")

#Name = textType.Name

#textSize = textType.get_Parameter("Text Size")
# ----------------------------------------
watch = Watch(python_script)
code_block = CodeBlock { 1; }
getItemAtIndex = List.GetItemAtIndex(list=python_script, index=code_block)
class_ = Custom[Object.Class](obj=getItemAtIndex)  # Gets the input object's class name. Can process lists.
select_model_element_2 = DSModelElementSelection()  # 1 picked in the model
python_script_2 = Python(IN[0]=select_model_element_2)
# ---------- python_script_2.python (71 lines) ----------
#Copyright(c) 2015, Konrad K Sobon
# @arch_laboratory, http://archi-lab.net

import clr
import sys
clr.AddReference('ProtoGeometry')
from Autodesk.DesignScript.Geometry import *

pyt_path = r'C:\Program Files (x86)\IronPython 2.7\Lib'
sys.path.append(pyt_path)

# Import Element wrapper extension methods
clr.AddReference("RevitNodes")
import Revit
clr.ImportExtensions(Revit.Elements)

# Import DocumentManager and TransactionManager
clr.AddReference("RevitServices")
import RevitServices
from RevitServices.Persistence import DocumentManager
from RevitServices.Transactions import TransactionManager

doc = DocumentManager.Instance.CurrentDBDocument
uiapp = DocumentManager.Instance.CurrentUIApplication
app = uiapp.Application

# Import RevitAPI
clr.AddReference("RevitAPI")
import Autodesk
from Autodesk.Revit.DB import *
import System

#The inputs to this node will be stored as a list in the IN variable.

stair = UnwrapElement(IN[0])

stairId = stair.Id

element = doc.GetElement(stairId)

groups = doc.Settings.Categories


#OUT = element.BaseElevation,element.TopElevation,element.Height,element.Geometry

OUT = groups.Name

"""
cats = IN[0]

elementlist = list()
# This could be more elegant if only I knew how to implement a Multicategory filter in Python....
for item in cats:
	collector = FilteredElementCollector(doc)
	collector.OfClass(FamilySymbol)
	bic = System.Enum.ToObject(BuiltInCategory, item.Id)
	collector.OfCategory(bic)
	elementlist.append(collector.ToElements())
OUT = elementlist
"""


"""
TransactionManager.Instance.EnsureInTransaction(doc)

for it in item:
	t = doc.GetElement(it)
	itemName.append(t)
	
TransactionManager.Instance.TransactionTaskDone()
"""	
# ----------------------------------------
class_2 = Custom[Object.Class](obj=python_script_2)
code_block_2 = CodeBlock { 1; }
name = Category.Name(python_script_2)
all_families_of_category = Custom[All Families Of Category]()  # Gets all famiies of a given category in the model (does *not *work for system families); unwired: category
python_script_3 = Python(IN[0]=select_model_element_2)
# ---------- python_script_3.python (56 lines) ----------
#Copyright(c) 2015, Konrad K Sobon
# @arch_laboratory, http://archi-lab.net

import clr
import sys
clr.AddReference('ProtoGeometry')
from Autodesk.DesignScript.Geometry import *

pyt_path = r'C:\Program Files (x86)\IronPython 2.7\Lib'
sys.path.append(pyt_path)

# Import Element wrapper extension methods
clr.AddReference("RevitNodes")
import Revit
clr.ImportExtensions(Revit.Elements)

# Import DocumentManager and TransactionManager
clr.AddReference("RevitServices")
import RevitServices
from RevitServices.Persistence import DocumentManager
from RevitServices.Transactions import TransactionManager

doc = DocumentManager.Instance.CurrentDBDocument
uiapp = DocumentManager.Instance.CurrentUIApplication
app = uiapp.Application

# Import RevitAPI
clr.AddReference("RevitAPI")
import Autodesk
from Autodesk.Revit.DB import *
import System


cats = IN[0]

elementlist = list()
# This could be more elegant if only I knew how to implement a Multicategory filter in Python....
collector = FilteredElementCollector(doc)
collector.OfClass(FamilySymbol)
bic = System.Enum.ToObject(BuiltInCategory, cats.Id)
collector.OfCategory(bic)
elementlist.append(collector.ToElements())

OUT = elementlist



"""
TransactionManager.Instance.EnsureInTransaction(doc)

for it in item:
	t = doc.GetElement(it)
	itemName.append(t)
	
TransactionManager.Instance.TransactionTaskDone()
"""	
# ----------------------------------------
element_types = ElementTypes("StairsLanding")
all_elements_of_type = ElementsOfType(element_types)
geometry = Element.Geometry(all_elements_of_type)
watch_2 = Watch(all_elements_of_type)
integer_slider = IntegerSlider(1, range=0..5 step 1)
getItemAtIndex_2 = List.GetItemAtIndex(list=watch_2, index=integer_slider)
boundingBox = Geometry.BoundingBox(getItemAtIndex_2)
integer_slider_2 = IntegerSlider(0, range=0..5 step 1)
getItemAtIndex_3 = List.GetItemAtIndex(list=boundingBox, index=integer_slider_2)
minPoint = BoundingBox.MinPoint(getItemAtIndex_3)
maxPoint = BoundingBox.MaxPoint(getItemAtIndex_3)
byCorners = Cuboid.ByCorners(lowPoint=minPoint, highPoint=maxPoint)
