# Dynamo graph Stairs01.dyn (Dynamo 1.2.0.2514)

select_model_element = DSModelElementSelection()  # 1 picked in the model
python_script = Python(IN[0]=select_model_element)
# ---------- python_script.python (73 lines) ----------
#Copyright(c) 2015, Konrad K Sobon
# @arch_laboratory, http://archi-lab.net

import clr
import sys
clr.AddReference('ProtoGeometry')
from Autodesk.DesignScript.Geometry import *

pyt_path = r'C:\Program Files (x86)\IronPython 2.7\Lib'
sys.path.append(pyt_path)

# Import Element wrapper extension methods
clr.AddReference("RevitNodes")
import Revit
clr.ImportExtensions(Revit.Elements)

# Import DocumentManager and TransactionManager
clr.AddReference("RevitServices")
import RevitServices
from RevitServices.Persistence import DocumentManager
from RevitServices.Transactions import TransactionManager

doc = DocumentManager.Instance.CurrentDBDocument
uiapp = DocumentManager.Instance.CurrentUIApplication
app = uiapp.Application

# Import RevitAPI
clr.AddReference("RevitAPI")
import Autodesk
from Autodesk.Revit.DB import *
import System

#The inputs to this node will be stored as a list in the IN variable.

items = UnwrapElement(IN[0])

itemsType = items.GetTypeId()

item = items.GetValidTypes()

itemName = []

run = []
	
TransactionManager.Instance.EnsureInTransaction(doc)

for it in item:
	t = doc.GetElement(it)
	itemName.append(t)
	
TransactionManager.Instance.TransactionTaskDone()
	
#run.append(t.get_Parameter(BuiltInParameter.STAIRS_RUN_HEIGHT))

OUT = itemName

#AssemblyCode = type.get_Parameter(BuiltInParameter.TEXT_SIZE).AsString()


#bipNumber = BuiltInParameter.TEXT_SIZE
 
#tempSheetNum = bipNumber.get_Parameter(bipNumber).AsString()
 
    
#textSizeParam = textType.get_Parameter(BuiltInParameter.TEXT_SIZE);

#paramTextUnderline = textType.get_Parameter(BuiltInParameter.TEXT_STYLE_UNDERLINE)

#paramTextUnderline = textType.get_Parameter("TEXT_STYLE_UNDERLINE")

#Name = textType.Name

#textSize = textType.get_Parameter("Text Size")
# ----------------------------------------
watch = Watch(python_script)
code_block = CodeBlock { 1; }
getItemAtIndex = List.GetItemAtIndex(list=python_script, index=code_block)
class_ = Custom[Object.Class](obj=getItemAtIndex)  # Gets the input object's class name. Can process lists.
select_model_element_2 = DSModelElementSelection()  # 1 picked in the model
python_script_2 = Python(IN[0]=select_model_element_2)
# ---------- python_script_2.python (71 lines) ----------
#Copyright(c) 2015, Konrad K Sobon
# @arch_laboratory, http://archi-lab.net

import clr
import sys
clr.AddReference('ProtoGeometry')
from Autodesk.DesignScript.Geometry import *

pyt_path = r'C:\Program Files (x86)\IronPython 2.7\Lib'
sys.path.append(pyt_path)

# Import Element wrapper extension methods
clr.AddReference("RevitNodes")
import Revit
clr.ImportExtensions(Revit.Elements)

# Import DocumentManager and TransactionManager
clr.AddReference("RevitServices")
import RevitServices
from RevitServices.Persistence import DocumentManager
from RevitServices.Transactions import TransactionManager

doc = DocumentManager.Instance.CurrentDBDocument
uiapp = DocumentManager.Instance.CurrentUIApplication
app = uiapp.Application

# Import RevitAPI
clr.AddReference("RevitAPI")
import Autodesk
from Autodesk.Revit.DB import *
import System

#The inputs to this node will be stored as a list in the IN variable.

stair = UnwrapElement(IN[0])

stairId = stair.Id

element = doc.GetElement(stairId)

groups = doc.Settings.Categories


#OUT = element.BaseElevation,element.TopElevation,element.Height,element.Geometry

OUT = groups.Name

"""
cats = IN[0]

elementlist = list()
# This could be more elegant if only I knew how to implement a Multicategory filter in Python....
for item in cats:
	collector = FilteredElementCollector(doc)
	collector.OfClass(FamilySymbol)
	bic = System.Enum.ToObject(BuiltInCategory, item.Id)
	collector.OfCategory(bic)
	elementlist.append(collector.ToElements())
OUT = elementlist
"""


"""
TransactionManager.Instance.EnsureInTransaction(doc)

for it in item:
	t = doc.GetElement(it)
	itemName.append(t)
	
TransactionManager.Instance.TransactionTaskDone()
"""	
# ----------------------------------------
class_2 = Custom[Object.Class](obj=python_script_2)
code_block_2 = CodeBlock { 1; }
name = Category.Name(python_script_2)
all_families_of_category = Custom[All Families Of Category]()  # Gets all famiies of a given category in the model (does *not *work for system families); unwired: category
python_script_3 = Python(IN[0]=select_model_element_2)
# ---------- python_script_3.python (56 lines) ----------
#Copyright(c) 2015, Konrad K Sobon
# @arch_laboratory, http://archi-lab.net

import clr
import sys
clr.AddReference('ProtoGeometry')
from Autodesk.DesignScript.Geometry import *

pyt_path = r'C:\Program Files (x86)\IronPython 2.7\Lib'
sys.path.append(pyt_path)

# Import Element wrapper extension methods
clr.AddReference("RevitNodes")
import Revit
clr.ImportExtensions(Revit.Elements)

# Import DocumentManager and TransactionManager
clr.AddReference("RevitServices")
import RevitServices
from RevitServices.Persistence import DocumentManager
from RevitServices.Transactions import TransactionManager

doc = DocumentManager.Instance.CurrentDBDocument
uiapp = DocumentManager.Instance.CurrentUIApplication
app = uiapp.Application

# Import RevitAPI
clr.AddReference("RevitAPI")
import Autodesk
from Autodesk.Revit.DB import *
import System


cats = IN[0]

elementlist = list()
# This could be more elegant if only I knew how to implement a Multicategory filter in Python....
collector = FilteredElementCollector(doc)
collector.OfClass(FamilySymbol)
bic = System.Enum.ToObject(BuiltInCategory, cats.Id)
collector.OfCategory(bic)
elementlist.append(collector.ToElements())

OUT = elementlist



"""
TransactionManager.Instance.EnsureInTransaction(doc)

for it in item:
	t = doc.GetElement(it)
	itemName.append(t)
	
TransactionManager.Instance.TransactionTaskDone()
"""	
# ----------------------------------------
element_types = ElementTypes("StairsLanding")
all_elements_of_type = ElementsOfType(element_types)
watch_2 = Watch(all_elements_of_type)
integer_slider = IntegerSlider(1, range=0..5 step 1)
getItemAtIndex_2 = List.GetItemAtIndex(list=watch_2, index=integer_slider)
boundingBox = Geometry.BoundingBox(getItemAtIndex_2)
integer_slider_2 = IntegerSlider(0, range=0..5 step 1)
getItemAtIndex_3 = List.GetItemAtIndex(list=boundingBox, index=integer_slider_2)
minPoint = BoundingBox.MinPoint(getItemAtIndex_3)
maxPoint = BoundingBox.MaxPoint(getItemAtIndex_3)
byCorners = Cuboid.ByCorners(lowPoint=minPoint, highPoint=maxPoint)
element_types_2 = ElementTypes("StairsRun")
all_elements_of_type_2 = ElementsOfType(element_types_2)
geometry = Element.Geometry(all_elements_of_type_2)
byGeometry = BoundingBox.ByGeometry(geometry)
minPoint_2 = BoundingBox.MinPoint(byGeometry)
maxPoint_2 = BoundingBox.MaxPoint(byGeometry)
deconstructPoint = Geometry.Points.DeconstructPoint(maxPoint_2)
deconstructPoint_2 = Geometry.Points.DeconstructPoint(minPoint_2)
byCoordinates = Point.ByCoordinates(x=deconstructPoint.out0, y=deconstructPoint.out1, z=deconstructPoint_2.out2)
byTwoPoints = Vector.ByTwoPoints(start=minPoint_2, end=byCoordinates)
ZAxis = Vector.ZAxis()
byCorners_2 = Cuboid.ByCorners(lowPoint=minPoint_2, highPoint=maxPoint_2)
width = Cuboid.Width(byCorners_2)
length = Cuboid.Length(byCorners_2)
code_block_3 = CodeBlock(a=width, b=length) { a/b; }
atan = Math.Atan(code_block_3)
code_block_4 = CodeBlock(a=atan) { -(90-a); }
rotate = Vector.Rotate(byTwoPoints, ZAxis, code_block_4)
byStartPointDirectionLength = Line.ByStartPointDirectionLength(startPoint=minPoint_2, direction=rotate, length=width)
code_block_5 = CodeBlock(a=length) { a/2; }
translate = Geometry.Translate(geometry=byStartPointDirectionLength, yTranslation=code_block_5)

# group: Number of Sections
code_block_6 = CodeBlock { 2; }

split = Custom[List.Split](list=translate, amount=code_block_6)  # Splits a list at the desired length
geometry_2 = Element.Geometry(split.list1)
curves = Element.Curves()  # unwired: arg0
code_block_7 = CodeBlock { 0.5; }
pointAtParameter = Curve.PointAtParameter(curve=split.list1, param=code_block_7)

# group: STRUCTURAL FRAMING LOCAL AXIS DIRECTION
boolean = BoolSelector(false)
reverse = Curve.Reverse(split.list1)
# note: Reverse section views ?
if_ = If(test=boolean, true=reverse, false=split.list1)
direction = Line.Direction(if_)
code_block_8 = CodeBlock { 0; }
# note: Normal vector in local y-dir
normalAtParameter = Curve.NormalAtParameter(curve=if_, param=code_block_8)
code_block_9 = CodeBlock { -90; }
# note: Normal vector in local z-dir
rotate_2 = Vector.Rotate(normalAtParameter, direction, code_block_9)

# group: VECTOR DEFINITION STRUCTURAL FRAMING
transpose = List.Transpose(direction)
flatten = Flatten(transpose)
transpose_2 = List.Transpose(rotate_2)
flatten_2 = Flatten(transpose_2)

# group: APPLY CS AND WORKPLANE
# note: Defines the coordinate system for the direction of the section view.
# This is taken in the centroid of the solid geometry to be able to define negative and positive values for the min/max point
# Top view:
# X=length axis element
# Y=normal at length axis
# Front view:
# X=length axis element
# Y=Global Z axis
# Cross section view:
# X=normal axis element
# Y=Global Z axis
byOriginVectors = CoordinateSystem.ByOriginVectors(origin=pointAtParameter, xAxis=flatten, yAxis=flatten_2, lacing=Longest)
# note: Generate a plane at the solid center which is orientated to the view cs. This plane is used to detect the boundaries of the section view.
byOriginXAxisYAxis = Plane.ByOriginXAxisYAxis(pointAtParameter, flatten, flatten_2)

# group: DETECT SECTION BOUNDARY CURVES AND WORKPOINTS
intersect = Geometry.Intersect(geometry=split.list1, other=byOriginXAxisYAxis, lacing=Longest)
# note: Detect the perimeter curves of the cutting surface at the solid centroid
flatten_3 = Flatten(intersect)
# note: Get the single curves and their starting point to define the min and max boundary values
startPoint = Curve.StartPoint(flatten_3)

# group: TRANSLATE TO WCS FOR minPoint / maxPoint Calc
identity = CoordinateSystem.Identity()
transform = Geometry.Transform(contextCoordinateSystem=identity)  # unwired: geometry, fromCoordinateSystem
# note: As Point.X and Point.Y only work according to global WCS, the curves are transformed from the solid.centroid to the WCS in order to define the MinPoint and MaxPoint of the cut surface (offset values already included)
combine = List.Combine(transform, startPoint, byOriginVectors)
X = Point.X(combine)
minimumItem = List.MinimumItem(X)

deconstructPoint_3 = Geometry.Points.DeconstructPoint(minPoint_2)
flatten_4 = Flatten(deconstructPoint_3.out2)
abs = Math.Abs(flatten_4)
minimumItem_2 = List.MinimumItem(abs)
offset = CodeBlock { 1000; }
code_block_10 = CodeBlock(a=minimumItem_2, b=offset) { (a*-1)-b; }
code_block_11 = CodeBlock { 0; }
byCoordinates_2 = Point.ByCoordinates(x=minimumItem, y=code_block_10, z=code_block_11)
code_block_12 = CodeBlock(a=minimumItem) { a*-1; }
geometry_3 = Element.Geometry(all_elements_of_type)
byGeometry_2 = BoundingBox.ByGeometry(geometry_3)
maxPoint_3 = BoundingBox.MaxPoint(byGeometry_2)
deconstructPoint_4 = Geometry.Points.DeconstructPoint(maxPoint_3)
maximumItem = List.MaximumItem(deconstructPoint_4.out2)
crop_region_plan = CodeBlock { 200; }
byCoordinates_3 = Point.ByCoordinates(x=code_block_12, y=maximumItem, z=crop_region_plan)
code_block_13 = CodeBlock { 50; }

# group: CREATE SECTION VIEW ACCORDING BOUNDING BOX
byCoordinateSystemMinPointMaxPoint = SectionView.ByCoordinateSystemMinPointMaxPoint(byOriginVectors, byCoordinates_2, byCoordinates_3)
code_block_14 = CodeBlock { "View Scale"; }
setParameterByName = Element.SetParameterByName(element=byCoordinateSystemMinPointMaxPoint, parameterName=code_block_14, value=code_block_13)

# note: Top
code_block_15 = CodeBlock { 438; }
boolean_2 = BoolSelector(true)
active_view = Custom[Active View](refresh=boolean_2)
name_2 = Element.Name(active_view)
categories = Categories("Sheets")
all_elements_of_category = ElementsOfCategory(categories)
watch_3 = Watch(all_elements_of_category)
code_block_16 = CodeBlock { "Sheet Number"; }
getParameterValueByName = Element.GetParameterValueByName(element=watch_3, parameterName=code_block_16)
# note: 13.10.2016
# Dynamo 0.8
string = StringInput("1000")
eq = getParameterValueByName == string  # lacing=CrossProduct
countTrue = CountTrue(eq, lacing=Longest)
code_block_17 = CodeBlock { 1; }
eq_2 = countTrue == code_block_17  # lacing=CrossProduct
flatten_5 = Flatten(eq_2)
filterByBoolMask = List.FilterByBoolMask(list=watch_3, mask=flatten_5)
flatten_6 = Flatten(filterByBoolMask.in)
# note: Left
code_block_18 = CodeBlock { 188; }
# note: Right
code_block_19 = CodeBlock { 563; }
create = List.Create(code_block_18, code_block_19)
code_block_20 = CodeBlock(a=create) { a/304; }
# note: Bottom
code_block_21 = CodeBlock { 1; }
create_2 = List.Create(code_block_21, code_block_21)
code_block_22 = CodeBlock(b=create_2) { b/304; }
# note: Sheet
# note: Pt x
# note: View
# note: Pt y
python_script_4 = Python(IN[0]=flatten_6, IN[1]=byCoordinateSystemMinPointMaxPoint, IN[2]=code_block_20, IN[3]=code_block_22)
# ---------- python_script_4.python (74 lines) ----------
#Put view on sheet
import clr
clr.AddReference('RevitAPI')
from Autodesk.Revit.DB import *

clr.AddReference("RevitNodes")
import Revit
clr.ImportExtensions(Revit.Elements)

clr.AddReference("RevitServices")
import RevitServices
from RevitServices.Persistence import DocumentManager
from RevitServices.Transactions import TransactionManager

import clr
clr.AddReference('ProtoGeometry')

from Autodesk.DesignScript.Geometry import *

doc = DocumentManager.Instance.CurrentDBDocument

if isinstance(IN[0], list):
	sheets = []
	for i in IN[0]:
		sheets.append(UnwrapElement(i))
else:
	sheets = [UnwrapElement(IN[0])]
	
	
if isinstance(IN[1], list):
	views = []
	for i in IN[1]:
		views.append(UnwrapElement(i))
else:
	views = [UnwrapElement(IN[1])]


if isinstance(IN[2], list):
	ptx = []
	for i in IN[2]:
		ptx.append(float(UnwrapElement(i)))
else:
	ptx = [UnwrapElement(IN[2])]


if isinstance(IN[3], list):
	pty = []
	for i in IN[3]:
		pty.append(float(UnwrapElement(i)))
else:
	pty = [UnwrapElement(IN[3])]

pts=[]

for j,k in zip(ptx,pty):
	pts.append(Point.ByCoordinates(j,k))
	

TransactionManager.Instance.EnsureInTransaction(doc) # you need an active transaction as you will create elements

vport=[]

for i in views:
	vport.append(Viewport.Create(doc,sheets[0].Id,i.Id,XYZ.Zero))

for v,p in zip(vport,pts):
	v.SetBoxCenter(XYZ(p.X,p.Y,p.Z))
	
	
TransactionManager.Instance.TransactionTaskDone()		



OUT = pts
# ----------------------------------------
minPoint_3 = BoundingBox.MinPoint(byGeometry_2)
views = Views("02")
element_types_3 = ElementTypes("ViewFamilyType")
all_elements_of_type_3 = ElementsOfType(element_types_3)
watch_4 = Watch(all_elements_of_type_3)
name_3 = Element.Name(watch_4)
code_block_23 = CodeBlock { "70 - Sh - G.A. Plan (Colour by Slab Level)"; }
contains = String.Contains(str=name_3, searchFor=code_block_23)
filterByBoolMask_2 = List.FilterByBoolMask(list=watch_4, mask=contains)
code_block_24 = CodeBlock(a=byGeometry_2) { a[0]; }
minPoint_4 = BoundingBox.MinPoint(code_block_24)
maxPoint_4 = BoundingBox.MaxPoint(code_block_24)
python_script_5 = Python(IN[0]=views, IN[1]=filterByBoolMask_2.in, IN[2]=minPoint_4, IN[3]=maxPoint_4)
# ---------- python_script_5.python (40 lines) ----------
#Put view on sheet
import clr
clr.AddReference('RevitAPI')
from Autodesk.Revit.DB import *

clr.AddReference("RevitNodes")
import Revit
clr.ImportExtensions(Revit.Elements)

clr.AddReference("RevitServices")
import RevitServices
from RevitServices.Persistence import DocumentManager
from RevitServices.Transactions import TransactionManager

import clr
clr.AddReference('ProtoGeometry')

from Autodesk.DesignScript.Geometry import *

doc = DocumentManager.Instance.CurrentDBDocument

pView = UnwrapElement(IN[0])

FamType = UnwrapElement(IN[1])	

pt1 = UnwrapElement(IN[2])	

pt2 = UnwrapElement(IN[3])	

TransactionManager.Instance.EnsureInTransaction(doc) # you need an active transaction as you will create elements

vport=[]

view = ViewSection.CreateCallout(doc, pView.Id, FamType[0].Id, XYZ(pt1.X,pt1.Y,pt1.Z), XYZ(pt2.X,pt2.Y,pt2.Z))


	
TransactionManager.Instance.TransactionTaskDone()		

OUT = view
# ----------------------------------------
name_4 = Element.Name(filterByBoolMask_2.in)
byCorners_3 = Cuboid.ByCorners(lowPoint=minPoint_4, highPoint=maxPoint_4)
create_3 = List.Create(geometry_3, geometry)
flatten_7 = Flatten(create_3)
byUnion = Solid.ByUnion(flatten_7)
byGeometry_3 = BoundingBox.ByGeometry(byUnion)
