# Dynamo graph Structural Columns.dyn (Dynamo 0.8.2.2392)

select_model_elements = DSModelElementsSelection()  # 2 picked in the model
geometry = Element.Geometry(select_model_elements)
deconstructPolyCurve = Geometry.Curves.DeconstructPolyCurve(geometry)
levels = Levels("00")
structural_column_types = StructuralColumnTypes("600 x 750mm")
columnByCurve = StructuralFraming.ColumnByCurve(deconstructPolyCurve, levels, structural_column_types)
code_block = CodeBlock(lst=columnByCurve) { Flatten(lst<1>); }
code_block_2 = CodeBlock { "Mark"; }
code_block_3 = CodeBlock(a=columnByCurve) { 0..Count(a)-1; }
count = Count(code_block, lacing=Longest)
cycle_entries_of_one_list_by = Custom[Cycle Entries of one List by List of Lengths](listToCycle=code_block_3, listOfLengths=count)
string_from_object = FromObject(cycle_entries_of_one_list_by)
setParameterByName = Element.SetParameterByName(element=code_block, parameterName=code_block_2, value=string_from_object)
watch = Watch(deconstructPolyCurve)
pointAtDistance = Curve.PointAtDistance(lacing=Longest)
select_model_elements_2 = DSModelElementsSelection()  # 1 picked in the model
geometry_2 = Element.Geometry(select_model_elements_2)
code_block_4 = CodeBlock { "SURFACE"; }
byClassName = Custom[Filter.ByClassName](object_s=geometry_2, Class_name_s=code_block_4)  # Filters a list of objects by the object's class name. Note that Dynamo elements belong to different classes than their Revit counterparts. Use the Object.Class node to check an object's class.
perimeterCurves = Surface.PerimeterCurves(byClassName.in)
code_block_5 = CodeBlock(a=perimeterCurves) { a[3]; }
floor_types = FloorTypes("STR-Conc Precast Nwt (300mm)")
levels_2 = Levels("00")
byOutlineTypeAndLevel = Floor.ByOutlineTypeAndLevel(floorType=floor_types, level=levels_2)
byOutlineTypeAndLevel_2 = Floor.ByOutlineTypeAndLevel(outlineCurves=perimeterCurves, floorType=floor_types, level=levels_2)
