# Dynamo graph Surface Area.dyn (Dynamo 0.8.2.2392)

file_path = Filename("X:\4 Internal Data\05 1F4\08 BIM\02 Structural\Extractions\SCH\20161130 Waterproof Area\SArea.xlsx")

# group: SHEET NAME
string = StringInput("Area4")

number = DoubleInput(1)
number_2 = DoubleInput(0)

# group: SELECT MASS
select_model_element = DSModelElementSelection()  # 1 picked in the model

geometry = Element.Geometry(select_model_element)
explode = Geometry.Explode(geometry)
flatten = Flatten(explode)
area = Surface.Area(flatten)
code_block = CodeBlock { 0; }
sortIndexByValue = SortIndexByValue(area, code_block)
reorder = Reorder(flatten, sortIndexByValue)
code_block_2 = CodeBlock { 8; }
dropItems = List.DropItems(list=reorder, amount=code_block_2)
area_2 = Surface.Area(dropItems)
sum = Math.Sum(area_2)
convert_between_units = DynamoConvert(sum, conversionMetric=Area, conversionFrom=SquareMillimeter, conversionTo=SquareMeter)
code_block_3 = CodeBlock { 0; }
writeToFile = Excel.WriteToFile(filePath=file_path, sheetName=string, startRow=number, startCol=number_2, data=convert_between_units, overWrite=code_block_3)
