# Dynamo graph TEST.dyn (Dynamo 1.3.1.1736)

curveToLine = Custom[CurveToLine]()  # Turn any none line curve into a list of individual lines.; unwired: Crv, length
code_block = CodeBlock { 1; }
python_script = Python(IN[0]=code_block)
# ---------- python_script.python (110 lines) ----------
#Copyright(c) 2014, Nathan Miller
# The Proving Ground, http://theprovingground.org

import clr

# Import RevitAPI
clr.AddReference("RevitAPI")
import Autodesk
from Autodesk.Revit.DB import *

# Import DocumentManager and TransactionManager
clr.AddReference("RevitServices")
import RevitServices
from RevitServices.Persistence import DocumentManager
from RevitServices.Transactions import TransactionManager

# Import ToDSType(bool) extension method
clr.AddReference("RevitNodes")
import Revit
clr.ImportExtensions(Revit.Elements)
clr.ImportExtensions(Revit.GeometryConversion)

import clr
clr.AddReference('ProtoGeometry')
from Autodesk.DesignScript.Geometry import *

#The input to this node will be stored in the IN[0] variable.

doc =  DocumentManager.Instance.CurrentDBDocument
app =  DocumentManager.Instance.CurrentUIApplication.Application

toggle = IN[0]

output = []
rooms = []
names = []
numbers = []
areas = []
levels = []
boundaries = []
locations = []
areaschemes = []
elementids = []
uniqueids = []

if toggle == True:

	collector = FilteredElementCollector(doc)
	collector.OfCategory(BuiltInCategory.OST_Areas)
 
	famtypeitr = collector.GetElementIdIterator()
	famtypeitr.Reset()


	for item in famtypeitr:
		famtypeID = item
		faminst = doc.GetElement(famtypeID)
    
		#print faminst
		if faminst.Area > 0:
			room = faminst
			for p in room.Parameters:
				if p.Definition.Name == 'LoadDescription':		
					roomname = p.AsString()
				if p.Definition.Name == 'Level':			
					level = p.AsValueString()
					if (level is None):
						level = p.AsString()

			number = faminst.Number
			area = faminst.Area
			location = faminst.Location.Point.ToPoint()
			areascheme = faminst.AreaScheme.Name
			elementid = faminst.Id.ToString()
			uniqueid = faminst.UniqueId
    	
			boptions = Autodesk.Revit.DB.SpatialElementBoundaryOptions()
			boundsegs = room.GetBoundarySegments(boptions)
			boundcurves = []
			for bound in boundsegs:
				crvs = []
				for seg in bound:
					crv = seg.GetCurve()
					crvs.append(Revit.GeometryConversion.RevitToProtoCurve.ToProtoType( crv, True ))
				boundcurves.append(crvs)
    	
			rooms.append(room)
			names.append(roomname)
			numbers.append(number)
			areas.append(area)
			levels.append(level)
			boundaries.append(boundcurves)
			areaschemes.append(areascheme)
			locations.append(location)
			elementids.append(elementid)
			uniqueids.append(uniqueid)
        
	output.append(rooms)
	output.append(names)
	output.append(numbers)
	output.append(areas)
	output.append(levels)
	output.append(locations)
	output.append(boundaries)
	output.append(areaschemes)
	output.append(elementids)
	output.append(uniqueids)
        
#Assign your output to the OUT variable
OUT = output
# ----------------------------------------
code_block_2 = CodeBlock(A=python_script) { A[6]; }
code_block_3 = CodeBlock { 0; }
offset = Curve.Offset(curve=code_block_2, distance=code_block_3)
code_block_4 = CodeBlock { 100.0; }
code_block_5 = CodeBlock(offset, code_block_4)
# ---------- code_block_5.designscript (39 lines) ----------
def ToLines(Crv, Len:double)
{
 output = 0;
 return = [Imperative]
 {
  if (Crv.Length != CrvLine(Crv))
  {
   output = SplitCurve(Crv,Len);
  }
  else
  {
   output = Crv;
  }
  return = output;
 }
};

def CrvLine(Crv)
{
 return = [Imperative]
 {
  return = Crv.StartPoint.DistanceTo(Crv.EndPoint);
 }
};

def SplitCurve(Crv, Len:double)
{
 output = 0;
 return = [Imperative]
 {
  counter = Math.Ceiling(Crv.Length/Len)+1;
  counter = Math.Max(counter,11);
  params = 0..1..#counter;
  PointList = Crv.PointAtParameter(params);
  Poly = PolyCurve.ByPoints(PointList);
  return = Poly.Curves();
 }
};
ToLines(Curv,length);
# ----------------------------------------
