# Dynamo graph Change Text v08.dyn (Dynamo 0.8.2.2392)

directory_path = Directory("No file selected.")
file_path = Filename("C:\Users\giovanni.brogioli\Documents\Dynamo\Scripts\Text\Text.xlsx")
fromPath = FileObject(file_path)  # "File.FromPath"
code_block = CodeBlock { "Sheet1"; }
boolean = BoolSelector(false)
readFromFile = Excel.ReadFromFile(file=fromPath, sheetName=code_block, readAsStrings=boolean)
flatten = Flatten(readFromFile)
python_script = Python(IN[1]=flatten)
# ---------- python_script.python (30 lines) ----------
import clr
clr.AddReference('RevitAPI')
from Autodesk.Revit.DB import *

clr.AddReference("RevitNodes")
import Revit
clr.ImportExtensions(Revit.Elements)

clr.AddReference("RevitServices")
import RevitServices
from RevitServices.Persistence import DocumentManager
from RevitServices.Transactions import TransactionManager

doc = DocumentManager.Instance.CurrentDBDocument
items = UnwrapElement(IN[0])
texts = IN[1]
goodlist = list()
badlist = list()

TransactionManager.Instance.EnsureInTransaction(doc)
for i in range(0,len(items)):
	try:
		items[i].Text = texts[i]
		goodlist.append(items[i])
	except:
		badlist.append(items[i])
	
TransactionManager.Instance.TransactionTaskDone()

OUT = (goodlist,badlist)
# ----------------------------------------
element_types = ElementTypes("TextNoteType")
all_elements_of_type = ElementsOfType(element_types)
parameters = Element.Parameters(all_elements_of_type)
name = Element.Name(all_elements_of_type)
select_model_elements = DSModelElementsSelection()  # 6 picked in the model
code_block_2 = CodeBlock { "Text"; }
setParameterByName = Element.SetParameterByName(element=select_model_elements, parameterName=code_block_2, value=flatten)
