# Dynamo graph Change Text.dyn (Dynamo 1.2.0.2514)

select_model_elements = DSModelElementsSelection()
file_path = Filename("C:\Users\giovanni.brogioli\Documents\Dynamo\Scripts\Text\Text.xlsx")
fromPath = FileObject(file_path)  # "File.FromPath"
code_block = CodeBlock { "Sheet1"; }
readFromFile = Excel.ReadFromFile(file=fromPath, sheetName=code_block)
flatten = Flatten(readFromFile)
python_script = Python(IN[0]=select_model_elements, IN[1]=flatten)
# ---------- python_script.python (30 lines) ----------
import clr
clr.AddReference('RevitAPI')
from Autodesk.Revit.DB import *

clr.AddReference("RevitNodes")
import Revit
clr.ImportExtensions(Revit.Elements)

clr.AddReference("RevitServices")
import RevitServices
from RevitServices.Persistence import DocumentManager
from RevitServices.Transactions import TransactionManager

doc = DocumentManager.Instance.CurrentDBDocument
items = UnwrapElement(IN[0])
texts = IN[1]
goodlist = []
badlist = []

TransactionManager.Instance.EnsureInTransaction(doc)
for i in range(0,len(items)):
	try:
		items[i].Text = texts[i]
		goodlist.append(items[i])
	except:
		badlist.append(items[i])
	
TransactionManager.Instance.TransactionTaskDone()

OUT = (goodlist,badlist)
# ----------------------------------------
parameters = Element.Parameters(select_model_elements)
setParameterByName = Element.SetParameterByName()  # unwired: element, parameterName, value
code_block_2 = CodeBlock { "TEXT_SIZE"; }
code_block_3 = CodeBlock { 1; }
python_script_2 = Python(IN[0]=code_block_2, IN[1]=select_model_elements, IN[2]=code_block_3)
# ---------- python_script_2.python (78 lines) ----------
#Copyright(c) 2015, Konrad K Sobon
# @arch_laboratory, http://archi-lab.net

import clr
import sys
clr.AddReference('ProtoGeometry')
from Autodesk.DesignScript.Geometry import *

pyt_path = r'C:\Program Files (x86)\IronPython 2.7\Lib'
sys.path.append(pyt_path)

# Import Element wrapper extension methods
clr.AddReference("RevitNodes")
import Revit
clr.ImportExtensions(Revit.Elements)

# Import DocumentManager and TransactionManager
clr.AddReference("RevitServices")
import RevitServices
from RevitServices.Persistence import DocumentManager
from RevitServices.Transactions import TransactionManager

doc = DocumentManager.Instance.CurrentDBDocument
uiapp = DocumentManager.Instance.CurrentUIApplication
app = uiapp.Application

# Import RevitAPI
clr.AddReference("RevitAPI")
import Autodesk
from Autodesk.Revit.DB import *
import System

#The inputs to this node will be stored as a list in the IN variable.
dataEnteringNode = IN

paramName = IN[0]
paramValues = IN[2]

if isinstance(IN[1], list):
	elements = []
	for i in IN[1]:
		elements.append(UnwrapElement(i))
else:
	elements = IN[1]

def GetBuiltInParam(paramName):
	builtInParams = System.Enum.GetValues(BuiltInParameter)
	test = []
	for i in builtInParams:
		if i.ToString() == paramName:
			test.append(i)
			break
		else:
			continue
	return test[0]

try:
	errorReport = None
	# "Start" the transaction
	TransactionManager.Instance.EnsureInTransaction(doc)
	
	bipName = GetBuiltInParam(paramName)
	for i, j in zip(elements, paramValues):
		param = i.get_Parameter(bipName)
		param.Set(j)
	
	# "End" the transaction
	TransactionManager.Instance.TransactionTaskDone()
except:
	# if error accurs anywhere in the process catch it
	import traceback
	errorReport = traceback.format_exc()

#Assign your output to the OUT variable
if errorReport == None:
	OUT = 0
else:
	OUT = errorReport
# ----------------------------------------
python_script_3 = Python(IN[0]=select_model_elements)
# ---------- python_script_3.python (48 lines) ----------
#Copyright(c) 2015, Konrad K Sobon
# @arch_laboratory, http://archi-lab.net

import clr
import sys
clr.AddReference('ProtoGeometry')
from Autodesk.DesignScript.Geometry import *

pyt_path = r'C:\Program Files (x86)\IronPython 2.7\Lib'
sys.path.append(pyt_path)

# Import Element wrapper extension methods
clr.AddReference("RevitNodes")
import Revit
clr.ImportExtensions(Revit.Elements)

# Import DocumentManager and TransactionManager
clr.AddReference("RevitServices")
import RevitServices
from RevitServices.Persistence import DocumentManager
from RevitServices.Transactions import TransactionManager

doc = DocumentManager.Instance.CurrentDBDocument
uiapp = DocumentManager.Instance.CurrentUIApplication
app = uiapp.Application

# Import RevitAPI
clr.AddReference("RevitAPI")
import Autodesk
from Autodesk.Revit.DB import *
import System

#The inputs to this node will be stored as a list in the IN variable.


textType = UnwrapElement(IN[0])

#doc.GetElement(img_type)

size = textType.get_Parameter(BuiltInParameter.TEXT_STYLE_SIZE)

font = textType.get_Parameter(BuiltInParameter.TEXT_FONT)

style = textType.get_Parameter(BuiltInParameter.TEXT_STYLE_UNDERLINE)

builtInParams = System.Enum.GetValues(BuiltInParameter)

OUT = builtInParams
# ----------------------------------------
watch = Watch(python_script_3)
select_model_elements_2 = DSModelElementsSelection()
string = StringInput("TEXT_STYLE_SIZE")
select_model_element = DSModelElementSelection()
code_block_4 = CodeBlock { "sorta"; }
python_script_4 = Python(IN[0]=select_model_element, IN[1]=code_block_4)
# ---------- python_script_4.python (82 lines) ----------
#Copyright(c) 2015, Konrad K Sobon
# @arch_laboratory, http://archi-lab.net

import clr
import sys
clr.AddReference('ProtoGeometry')
from Autodesk.DesignScript.Geometry import *

pyt_path = r'C:\Program Files (x86)\IronPython 2.7\Lib'
sys.path.append(pyt_path)

# Import Element wrapper extension methods
clr.AddReference("RevitNodes")
import Revit
clr.ImportExtensions(Revit.Elements)

# Import DocumentManager and TransactionManager
clr.AddReference("RevitServices")
import RevitServices
from RevitServices.Persistence import DocumentManager
from RevitServices.Transactions import TransactionManager

doc = DocumentManager.Instance.CurrentDBDocument
uiapp = DocumentManager.Instance.CurrentUIApplication
app = uiapp.Application

# Import RevitAPI
clr.AddReference("RevitAPI")
import Autodesk
from Autodesk.Revit.DB import *
import System

#The inputs to this node will be stored as a list in the IN variable.

text = UnwrapElement(IN[0])

textvalue = UnwrapElement(IN[1])

#textType = text.Symbol

#textType = text.GetTypeId()

img = text.GetValidTypes()

for img_type in img:
	t = doc.GetElement(img_type)



TransactionManager.Instance.EnsureInTransaction(doc)

textSize = t.get_Parameter(BuiltInParameter.TEXT_SIZE).AsDouble()

textBox = t.get_Parameter(BuiltInParameter.LINE_PEN).AsDouble

textBox = 5


TransactionManager.Instance.TransactionTaskDone()




OUT = textBox

#AssemblyCode = type.get_Parameter(BuiltInParameter.TEXT_SIZE).AsString()


#bipNumber = BuiltInParameter.TEXT_SIZE
 
#tempSheetNum = bipNumber.get_Parameter(bipNumber).AsString()
 
    
#textSizeParam = textType.get_Parameter(BuiltInParameter.TEXT_SIZE);

#paramTextUnderline = textType.get_Parameter(BuiltInParameter.TEXT_STYLE_UNDERLINE)

#paramTextUnderline = textType.get_Parameter("TEXT_STYLE_UNDERLINE")

#Name = textType.Name

#textSize = textType.get_Parameter("Text Size")
# ----------------------------------------
