# Dynamo graph Home.dyn (Dynamo 1.2.0.2514)

select_model_element = DSModelElementSelection()  # 1 picked in the model
get_builtinparameter_name = ItemSelector(select_model_element)
select_model_elements = DSModelElementsSelection()
