# Dynamo graph Rename Views v08.dyn (Dynamo 0.8.2.2392)

element_types = ElementTypes("ViewPlan")
element_types_2 = ElementTypes("ViewSection")
create = List.Create(element_types, element_types_2)
all_elements_of_type = ElementsOfType(create)
watch = Watch(all_elements_of_type)
code_block = CodeBlock { "TB_Sheet Name 1st Line"; }
setText = Custom[TextElement.SetText](lacing=Longest)  # Sets the text of a given text element (i.e. text note or model text)
string = StringInput("STAIRCORE57")
name = Parameter.Name(all_elements_of_type)
string_2 = StringInput("STAIRCORE ")
code_block_2 = CodeBlock { 14; }
string_from_object = FromObject(code_block_2)
concat = String.Concat(string_2, string_from_object)
contains = String.Contains(str=name, searchFor=concat)
filterByBoolMask = List.FilterByBoolMask(list=all_elements_of_type, mask=contains)
flatten = Flatten(filterByBoolMask.in)
code_block_3 = CodeBlock { "View Name"; }
getParameterValueByName = Element.GetParameterValueByName(element=all_elements_of_type, parameterName=code_block_3)
filterByBoolMask_2 = List.FilterByBoolMask(list=getParameterValueByName, mask=contains)
flatten_2 = Flatten(filterByBoolMask_2.in)
string_3 = StringInput("STAIRCORE ")
code_block_4 = CodeBlock(a=code_block_2) { a+50; }
string_from_object_2 = FromObject(code_block_4)
concat_2 = String.Concat(string_3, string_from_object_2)
replace = String.Replace(str=flatten_2, searchFor=concat, replaceWith=concat_2)
setParameterByName = Element.SetParameterByName(element=flatten, parameterName=code_block_3, value=replace)
string_4 = StringInput("STAIRCORE 56")
