# Dynamo graph Replace Text v08.dyn (Dynamo 0.8.2.2392)

element_types = ElementTypes("TextNote")
all_elements_of_type = ElementsOfType(element_types)
watch = Watch(all_elements_of_type)
getParameterValueByName = Element.GetParameterValueByName(element=all_elements_of_type)
code_block = CodeBlock { "STAIRCORE"; }
filter_text_notes_by_search = Custom[Filter Text Notes by Search](TextNotes=all_elements_of_type, containing=code_block)
text = Custom[TextElement.Text](element=filter_text_notes_by_search)  # Gets the text stored in a text element (i.e. text note or model text)
code_block_2 = CodeBlock { "09"; }
contains = String.Contains(str=text, searchFor=code_block_2)
filterByBoolMask = List.FilterByBoolMask(list=filter_text_notes_by_search, mask=contains)
code_block_3 = CodeBlock { "STAIRCORE 59"; }
setText = Custom[TextElement.SetText](element=filterByBoolMask.in, text=code_block_3, lacing=Longest)  # Sets the text of a given text element (i.e. text note or model text)
