# Dynamo graph 1 Create Bottom Chords.dyn (Dynamo 0.8.2.2392)

# group: SELECT BACK COLUMNS
select_model_elements = DSModelElementsSelection()  # 9 picked in the model

# group: SELECT FRONT COLUMNS
select_model_elements_2 = DSModelElementsSelection()  # 9 picked in the model

code_block = CodeBlock { 584.78; }

# group: CREATE COLUMNS END POINTS
location = Custom[Element.Location](element=select_model_elements)  # Returns the location of an element as an XYZ (or if it's line-based the start and end point of the line), along with some booleans to help filtering the results. Use this for some element types (e.g. walls or lines) that do not work with the built-in Get Family Instance Location node.
location_2 = Custom[Element.Location](element=select_model_elements_2)
code_block_2 = CodeBlock { Vector.ZAxis(); }
code_block_3 = CodeBlock(a=code_block) { a+6.5; }
code_block_4 = CodeBlock(a=code_block) { a+5; }
translate = Geometry.Translate(geometry=location_2.points, direction=code_block_2, distance=code_block_4)

code_block_5 = CodeBlock(a=location_2.points) { a.Y; }
code_block_6 = CodeBlock(a=location.points) { a.Y; }
eq = code_block_5 == code_block_6  # lacing=CrossProduct
python_script = Python(IN[0]=eq)
# ---------- python_script.python (11 lines) ----------
lista = IN[0]

bol =[]

for i in range(0,len(lista)):
	for j in range(0,len(lista[i])):
		if lista[i][j] == True:
			bol.append(lista.index(lista[j]))

OUT = bol
	
# ----------------------------------------
getItemAtIndex = List.GetItemAtIndex(list=location.points, index=python_script)

# group (continued): CREATE COLUMNS END POINTS
translate_2 = Geometry.Translate(geometry=getItemAtIndex, direction=code_block_2, distance=code_block_3)

# group: CREATE CHORDS
byStartPointEndPoint = Line.ByStartPointEndPoint(startPoint=translate_2, endPoint=translate)
levels = Levels("R01 BUS ROOF (LOWER)")
structural_framing_types = StructuralFramingTypes("UB356x171x51")
beamByCurve = StructuralFraming.BeamByCurve(byStartPointEndPoint, levels, structural_framing_types)
code_block_7 = CodeBlock { "z Justification"; }
code_block_8 = CodeBlock { 2; }
setParameterByName = Element.SetParameterByName(element=beamByCurve, parameterName=code_block_7, value=code_block_8)

# group: GET THE DISTANCE FROM THE ROOF
select_model_element = DSModelElementSelection()  # 1 picked in the model
geometry = Element.Geometry(select_model_element)
distanceTo = Geometry.DistanceTo(geometry=geometry, other=translate_2, lacing=Longest)

# group: GET THE DISTANCE FROM THE ROOF
select_model_element_2 = DSModelElementSelection()  # 1 picked in the model
geometry_2 = Element.Geometry(select_model_element_2)
distanceTo_2 = Geometry.DistanceTo(geometry=geometry_2, other=translate, lacing=Longest)
