# Dynamo graph Set For Construction.dyn (Dynamo 1.2.1.3083)

categories = Categories("TitleBlocks")
all_elements_of_category = ElementsOfCategory(categories)
code_block = CodeBlock { "Sheet Number"; }
getParameterValueByName = Element.GetParameterValueByName(element=all_elements_of_category, parameterName=code_block)
select = UINodes.SelectSheets.Select()
split = String.Split(select.out0, select.out1)
allIndicesOf = List.AllIndicesOf(list=getParameterValueByName, item=split)
flatten = Flatten(allIndicesOf)
getItemAtIndex = List.GetItemAtIndex(list=all_elements_of_category, index=flatten)
toNumber = String.ToNumber(select.out3)
setParameterByName = Element.SetParameterByName(element=getItemAtIndex, parameterName=select.out2, value=toNumber)
setParameterByName_2 = Element.SetParameterByName(element=getItemAtIndex, parameterName=select.out2, value=select.out3)
