# Dynamo graph UI.dyn (Dynamo 1.2.1.3083)

categories = Categories("Sheets")
all_elements_of_category = ElementsOfCategory(categories)
name = Element.Name(all_elements_of_category)
slapsProgram = SlapsUI.SlapsProgram.SlapsProgram()
code_block = CodeBlock { "Sheet List"; }
code_block_2 = CodeBlock { "Filter"; }
slapsComboBox2 = SlapsUI.SlapsProgram.SlapsComboBox2(slapsProgram, arg3=code_block, arg4=code_block_2)  # unwired: arg1, arg2
