# Dynamo graph Create Sheet Set (y).dyn (Dynamo 1.2.1.3083)

categories = Categories("Sheets")
# note: This workflow was created by BIMextension.com. Use at your own risk.
# Refer to http://bimextension.com/drawing-lists-in…ather-than-excel/ for a write up.
all_elements_of_category = ElementsOfCategory(categories)
code_block = CodeBlock { "Sheet Number"; }
getParameterValueByName = Element.GetParameterValueByName(element=all_elements_of_category, parameterName=code_block)
code_block_2 = CodeBlock { {990004,990005,990006,990100,990101,990102,990110,990111,990112,990113,990211,990217,990303,990311,990370,990371,990372,990515,990530,990550,990551,990552,990553,990560,990561,990562,990563,990564,990565,990566,990567,990568,990650}; }
string_from_object = FromObject(code_block_2)
allIndicesOf = List.AllIndicesOf(list=getParameterValueByName, item=string_from_object)
getItemAtIndex = List.GetItemAtIndex(list=all_elements_of_category, index=allIndicesOf)
flatten = Flatten(getItemAtIndex)
code_block_3 = CodeBlock { "NewSet"; }

# group: MAGIC
python_script = Python(IN[0]=flatten, IN[1]=code_block_3)
# ---------- python_script.python (52 lines) ----------
import clr
clr.AddReference('ProtoGeometry')
from Autodesk.DesignScript.Geometry import *

clr.AddReference('RevitAPI')
import Autodesk
from Autodesk.Revit.DB import *

clr.AddReference('RevitServices')
import RevitServices
from RevitServices.Persistence import DocumentManager
from RevitServices.Transactions import TransactionManager

doc = DocumentManager.Instance.CurrentDBDocument

sheets = IN[0]
sheetSetName = IN[1]

viewSet = ViewSet()

# try to add all of the sheets to the set
try:
 	for vs in sheets:
 		view = UnwrapElement(vs)
 		viewSet.Insert(view)
# If there’s one item in the set, just add the one
except:
 	view = UnwrapElement(sheets)
 	viewSet.Insert(view)

# Get the printmanager to add the view set to.
printManager = doc.PrintManager
printManager.PrintRange = PrintRange.Select

# create the ViewSheetSetting to append the viewset.
viewSheetSetting = printManager.ViewSheetSetting
viewSheetSetting.CurrentViewSheetSet.Views = viewSet

# Create the Sheet Set
trans = Transaction(doc, 'Create View/Sheet Set')

TransactionManager.Instance.ForceCloseTransaction()
trans.Start()
try:
 	viewSheetSetting.SaveAs(sheetSetName)
 	msg = 'Sheet set ' + sheetSetName + ' created.'
except:
 	msg = 'Failed to create sheet set'
trans.Commit()

#Assign your output to the OUT variable
OUT = msg
# ----------------------------------------

string = StringInput("990112")
contains = String.Contains(str=getParameterValueByName, searchFor=string, lacing=Longest)
filterByBoolMask = List.FilterByBoolMask(list=all_elements_of_category, mask=contains)
replaceItemAtIndex = List.ReplaceItemAtIndex()  # unwired: list, index, item
getParameterValueByName_2 = Element.GetParameterValueByName(element=getItemAtIndex, parameterName=code_block)
flatten_2 = Flatten(getParameterValueByName_2)
code_block_4 = CodeBlock(a=flatten_2) { a[0]; }
