# Dynamo graph VIEW POSITION.dyn (Dynamo 0.8.2.2392)

code_block = CodeBlock { "TB_Description"; }
code_block_2 = CodeBlock { "100% FINAL DESIGN"; }
categories = Categories("Sheets")
all_elements_of_category = ElementsOfCategory(categories)
watch = Watch(all_elements_of_category)
code_block_3 = CodeBlock { "Sheet Number"; }
getParameterValueByName = Element.GetParameterValueByName(element=watch, parameterName=code_block_3)
code_block_4 = CodeBlock { "030106"; }
eq = getParameterValueByName == code_block_4  # lacing=CrossProduct
countTrue = CountTrue(eq, lacing=Longest)
code_block_5 = CodeBlock { 1; }
eq_2 = countTrue == code_block_5  # lacing=CrossProduct
flatten = Flatten(eq_2)
filterByBoolMask = List.FilterByBoolMask(list=watch, mask=flatten)
flatten_2 = Flatten(filterByBoolMask.in)
code_block_6 = CodeBlock { "Sheet Name"; }
getParameterValueByName_2 = Element.GetParameterValueByName(element=flatten_2, parameterName=code_block_6)
views = Sheet.Views(flatten_2)
boundingBox = Geometry.BoundingBox(views)
maxPoint = BoundingBox.MaxPoint(boundingBox)
minPoint = BoundingBox.MinPoint(boundingBox)
code_block_7 = CodeBlock(a=maxPoint, b=minPoint) { (a.X+b.X)/2; }
code_block_8 = CodeBlock(a=maxPoint, b=minPoint) { (a.Y+b.Y)/2; }
code_block_9 = CodeBlock(a=maxPoint, b=minPoint) { (a.Z+b.Z)/2; }
byCoordinates = Point.ByCoordinates(x=code_block_7, y=code_block_8, z=code_block_9)
code_block_10 = CodeBlock { "ciao"; }
code_block_11 = CodeBlock { "91999"; }
family_types = FamilyTypes("Titleblock-Sketch-WIP:WIP")
element_types = ElementTypes("ViewDrafting")
all_elements_of_type = ElementsOfType(element_types)
name = Element.Name(all_elements_of_type)
code_block_12 = CodeBlock { "gio"; "true"; }
contains = String.Contains(str=name, searchFor=code_block_12.out0, ignoreCase=code_block_12.out1)
filterByBoolMask_2 = List.FilterByBoolMask(list=all_elements_of_type, mask=contains)
byNameNumberTitleBlockAndViews = Sheet.ByNameNumberTitleBlockAndViews(code_block_10, code_block_11, family_types, filterByBoolMask_2.in)
views_2 = Sheet.Views(byNameNumberTitleBlockAndViews)
setBoxCenter = Custom[Viewport.SetBoxCenter](Points=byCoordinates, Viewport_list=views_2)  # API class
code_block_13 = CodeBlock { 0; }
views_3 = Views("gio3")
byNameNumberTitleBlockAndView = Sheet.ByNameNumberTitleBlockAndView()
