# Dynamo graph view position3.dyn (Dynamo 0.8.2.2392)

code_block = CodeBlock { "TB_Description"; }
code_block_2 = CodeBlock { "100% FINAL DESIGN"; }
categories = Categories("Sheets")
all_elements_of_category = ElementsOfCategory(categories)
watch = Watch(all_elements_of_category)
code_block_3 = CodeBlock { "Sheet Number"; }
getParameterValueByName = Element.GetParameterValueByName(element=watch, parameterName=code_block_3)
code_block_4 = CodeBlock { "030106"; }
eq = getParameterValueByName == code_block_4  # lacing=CrossProduct
countTrue = CountTrue(eq, lacing=Longest)
code_block_5 = CodeBlock { 1; }
eq_2 = countTrue == code_block_5  # lacing=CrossProduct
flatten = Flatten(eq_2)
filterByBoolMask = List.FilterByBoolMask(list=watch, mask=flatten)
flatten_2 = Flatten(filterByBoolMask.in)
code_block_6 = CodeBlock { "Sheet Name"; }
getParameterValueByName_2 = Element.GetParameterValueByName(element=flatten_2, parameterName=code_block_6)
select_model_elements = DSModelElementsSelection()  # 6 picked in the model
viewPortBoxCenter = Custom[View.ViewPortBoxCenter](Viewports=select_model_elements)  # Get ViewPort Box center point
select_model_elements_2 = DSModelElementsSelection()  # 6 picked in the model
setBoxCenter = Custom[Viewport.SetBoxCenter](Points=viewPortBoxCenter, Viewport_list=select_model_elements_2)  # API class
views = Sheet.Views(flatten_2)
boundingBox = Geometry.BoundingBox(views)
maxPoint = BoundingBox.MaxPoint(boundingBox)
minPoint = BoundingBox.MinPoint(boundingBox)
code_block_7 = CodeBlock(a=maxPoint, b=minPoint) { (a.X+b.X)/2; }
code_block_8 = CodeBlock(a=maxPoint, b=minPoint) { (a.Y+b.Y)/2; }
code_block_9 = CodeBlock(a=maxPoint, b=minPoint) { (a.Z+b.Z)/2; }
byCoordinates = Point.ByCoordinates(x=code_block_7, y=code_block_8, z=code_block_9)
code_block_10 = CodeBlock { 0; }
views_2 = Views("gio3")
byNameNumberTitleBlockAndView = Sheet.ByNameNumberTitleBlockAndView()
code_block_11 = CodeBlock { "ciao"; }
code_block_12 = CodeBlock { "91999"; }
family_types = FamilyTypes("Titleblock-Sketch-WIP:WIP")
element_types = ElementTypes("ViewDrafting")
all_elements_of_type = ElementsOfType(element_types)
name = Element.Name(all_elements_of_type)
code_block_13 = CodeBlock { "gio"; "true"; }
contains = String.Contains(str=name, searchFor=code_block_13.out0, ignoreCase=code_block_13.out1)
filterByBoolMask_2 = List.FilterByBoolMask(list=all_elements_of_type, mask=contains)
byNameNumberTitleBlockAndViews = Sheet.ByNameNumberTitleBlockAndViews(code_block_11, code_block_12, family_types, filterByBoolMask_2.in)
views_3 = Sheet.Views(byNameNumberTitleBlockAndViews)
code_block_14 = CodeBlock { 5; }
code_block_15 = CodeBlock { 4; }
python_script = Python(IN[0]=byNameNumberTitleBlockAndViews, IN[1]=filterByBoolMask_2.in, IN[2]=code_block_14, IN[3]=code_block_15)
# ---------- python_script.python (35 lines) ----------
#Put view on sheet
import clr
clr.AddReference('RevitAPI')
from Autodesk.Revit.DB import *

clr.AddReference("RevitNodes")
import Revit
clr.ImportExtensions(Revit.Elements)

clr.AddReference("RevitServices")
import RevitServices
from RevitServices.Persistence import DocumentManager
from RevitServices.Transactions import TransactionManager




doc = DocumentManager.Instance.CurrentDBDocument
sheets = IN[0]
views = IN[1]
x = IN[2]
y = IN[3]
viewsplaced = list()


TransactionManager.Instance.EnsureInTransaction(doc) # you need an active transaction as you will create elements

for number in range(len(views)):
	sheet = UnwrapElement(sheets[number])
	view = UnwrapElement(views[number])
	Viewport.Create(doc,sheet.Id,view.Id,XYZ(x,y,0))
	viewsplaced.append(view.ToDSType(False))
	
TransactionManager.Instance.TransactionTaskDone()
OUT = viewsplaced
# ----------------------------------------
code_block_16 = CodeBlock { 0; }
setBoxCenter_2 = Custom[Viewport.SetBoxCenter]()
