# Dynamo graph view position4.dyn (Dynamo 0.8.2.2392)

select_model_elements = DSModelElementsSelection()  # 6 picked in the model
viewPortBoxCenter = Custom[View.ViewPortBoxCenter](Viewports=select_model_elements)  # Get ViewPort Box center point
select_model_elements_2 = DSModelElementsSelection()
setBoxCenter = Custom[Viewport.SetBoxCenter](Points=viewPortBoxCenter, Viewport_list=select_model_elements_2)  # API class
categories = Categories("Sheets")
all_elements_of_category = ElementsOfCategory(categories)
watch = Watch(all_elements_of_category)
code_block = CodeBlock { "Sheet Number"; }
getParameterValueByName = Element.GetParameterValueByName(element=watch, parameterName=code_block)
code_block_2 = CodeBlock { "030106"; }
eq = getParameterValueByName == code_block_2  # lacing=CrossProduct
countTrue = CountTrue(eq, lacing=Longest)
code_block_3 = CodeBlock { 1; }
eq_2 = countTrue == code_block_3  # lacing=CrossProduct
flatten = Flatten(eq_2)
filterByBoolMask = List.FilterByBoolMask(list=watch, mask=flatten)
flatten_2 = Flatten(filterByBoolMask.in)
views = Sheet.Views(flatten_2)
boundingBox = Geometry.BoundingBox(views)
maxPoint = BoundingBox.MaxPoint(boundingBox)
minPoint = BoundingBox.MinPoint(boundingBox)
code_block_4 = CodeBlock(a=maxPoint, b=minPoint) { (a.X+b.X)/2; }
code_block_5 = CodeBlock(a=maxPoint, b=minPoint) { (a.Y+b.Y)/2; }
code_block_6 = CodeBlock(a=maxPoint, b=minPoint) { (a.Z+b.Z)/2; }
byCoordinates = Point.ByCoordinates(x=code_block_4, y=code_block_5, z=code_block_6)
code_block_7 = CodeBlock { "ciao"; }
code_block_8 = CodeBlock { "91999"; }
family_types = FamilyTypes("Titleblock-Sketch-WIP:WIP")
element_types = ElementTypes("ViewDrafting")
all_elements_of_type = ElementsOfType(element_types)
name = Element.Name(all_elements_of_type)
code_block_9 = CodeBlock { "gio"; "true"; }
contains = String.Contains(str=name, searchFor=code_block_9.out0, ignoreCase=code_block_9.out1)
filterByBoolMask_2 = List.FilterByBoolMask(list=all_elements_of_type, mask=contains)
byNameNumberTitleBlockAndViews = Sheet.ByNameNumberTitleBlockAndViews(code_block_7, code_block_8, family_types, filterByBoolMask_2.in)
code_block_10 = CodeBlock { 5; }
code_block_11 = CodeBlock { 4; }
python_script = Python(IN[0]=byNameNumberTitleBlockAndViews, IN[1]=filterByBoolMask_2.in, IN[2]=code_block_10, IN[3]=code_block_11)
# ---------- python_script.python (35 lines) ----------
#Put view on sheet
import clr
clr.AddReference('RevitAPI')
from Autodesk.Revit.DB import *

clr.AddReference("RevitNodes")
import Revit
clr.ImportExtensions(Revit.Elements)

clr.AddReference("RevitServices")
import RevitServices
from RevitServices.Persistence import DocumentManager
from RevitServices.Transactions import TransactionManager




doc = DocumentManager.Instance.CurrentDBDocument
sheets = IN[0]
views = IN[1]
x = IN[2]
y = IN[3]
viewsplaced = list()


TransactionManager.Instance.EnsureInTransaction(doc) # you need an active transaction as you will create elements

for number in range(len(views)):
	sheet = UnwrapElement(sheets[number])
	view = UnwrapElement(views[number])
	Viewport.Create(doc,sheet.Id,view.Id,XYZ(x,y,0))
	viewsplaced.append(view.ToDSType(False))
	
TransactionManager.Instance.TransactionTaskDone()
OUT = viewsplaced
# ----------------------------------------
byNameNumberTitleBlockAndView = Sheet.ByNameNumberTitleBlockAndView()
code_block_12 = CodeBlock { 0; }
views_2 = Sheet.Views(byNameNumberTitleBlockAndViews)
views_3 = Views("gio3")
setBoxCenter_2 = Custom[Viewport.SetBoxCenter]()
code_block_13 = CodeBlock { 0; }
code_block_14 = CodeBlock { "Sheet Name"; }
getParameterValueByName_2 = Element.GetParameterValueByName(element=flatten_2, parameterName=code_block_14)
code_block_15 = CodeBlock { "100% FINAL DESIGN"; }
code_block_16 = CodeBlock { "TB_Description"; }
code_block_17 = CodeBlock {  }
file_path = Filename("C:\Users\giovanni.brogioli\Documents\Dynamo\New Microsoft Excel Worksheet.xlsx")
fromPath = FileObject(file_path)  # "File.FromPath"
code_block_18 = CodeBlock { "Sheet 1"; }
readFromFile = Excel.ReadFromFile(file=fromPath, sheetName=code_block_18)
code_block_19 = CodeBlock { 0; }
boolean = BoolSelector(true)
writeToFile = Excel.WriteToFile(filePath=file_path, sheetName=code_block_18, startRow=code_block_19, startCol=code_block_19, data=viewPortBoxCenter, overWrite=boolean)
