# Dynamo graph copyRevisions.dyn (Dynamo 1.3.1.1736)

# group: steam nodes
getFromLinkedFile = Custom[Element.GetFromLinkedFile]()  # Get elements from link document instance based on category; unwired: Link_Instance, Link_Document, Category

code_block = CodeBlock { 1; }
get_all_revisions = Custom[Get All Revisions](RunIt=code_block)  # This node will return all Revisions currently defined in the mode.
python_script = Python(IN[0]=code_block)
# ---------- python_script.python (45 lines) ----------
# Copyright(c) 2015, Konrad K Sobon
# @arch_laboratory, http://archi-lab.net

import clr
# Import Element wrapper extension methods
clr.AddReference("RevitNodes")
import Revit
clr.ImportExtensions(Revit.Elements)

# Import DocumentManager and TransactionManager
clr.AddReference("RevitServices")
import RevitServices
from RevitServices.Persistence import DocumentManager
doc = DocumentManager.Instance.CurrentDBDocument

# Import RevitAPI
clr.AddReference("RevitAPI")
import Autodesk
from Autodesk.Revit.DB import *

import sys
pyt_path = r'C:\Program Files (x86)\IronPython 2.7\Lib'
sys.path.append(pyt_path)

#The inputs to this node will be stored as a list in the IN variable.
dataEnteringNode = IN
RunIt = IN[0]

if RunIt:
	try:
		errorReport = None
		revisions = FilteredElementCollector(doc).OfCategory(BuiltInCategory.OST_Revisions).WhereElementIsNotElementType().ToElements()
	except:
		# if error accurs anywhere in the process catch it
		import traceback
		errorReport = traceback.format_exc()
else:
	errorReport = "RunIt set to False."


#Assign your output to the OUT variable
if errorReport == None:
	OUT = revisions
else:
	OUT = errorReport
# ----------------------------------------
name = Element.Name(python_script)
python_script_2 = Python()
# ---------- python_script_2.python (30 lines) ----------
import clr

clr.AddReference("RevitServices")
import RevitServices
from RevitServices.Persistence import DocumentManager
from RevitServices.Transactions import TransactionManager
doc = DocumentManager.Instance.CurrentDBDocument

clr.AddReference("RevitAPI")
import Autodesk
from Autodesk.Revit.DB import *

clr.AddReference("RevitNodes")
import Revit
clr.ImportExtensions(Revit.Elements)
clr.ImportExtensions(Revit.GeometryConversion)

#The inputs to this node will be stored as a list in the IN variable.
TransactionManager.Instance.EnsureInTransaction(doc)

newRevision = Revision.Create(doc)
newRevision.Description = "description"
newRevision.IssuedBy = "issuedBy"
newRevision.IssuedTo = "issuedTo"
newRevision.NumberType = RevisionNumberType.Alphanumeric
newRevision.RevisionDate = "10.01.2018"

TransactionManager.Instance.TransactionTaskDone()

OUT = newRevision
# ----------------------------------------
python_script_3 = Python()  # unwired: IN[0]; same code as python_script
python_script_4 = Python()
# ---------- python_script_4.python (22 lines) ----------
import clr
import System
clr.AddReference('RevitAPI')
clr.AddReference('RevitAPIUI')
from Autodesk.Revit.DB import *
import Autodesk
clr.AddReference("RevitNodes")
import Revit

clr.AddReference("RevitServices")
import RevitServices
from RevitServices.Persistence import DocumentManager
doc = DocumentManager.Instance.CurrentDBDocument

bics = System.Enum.GetValues(BuiltInCategory)
cdata = list()
for bic in bics:
	try:
		cdata.append((bic,ElementId(bic),Revit.Elements.Category.ById(ElementId(bic).IntegerValue)))
	except:
		pass
OUT = cdata, bics
# ----------------------------------------
builtInCategories = Custom[Document.BuiltInCategories]()  # List all the available BuiltInCategories
name_2 = Element.Name(builtInCategories.Categories)
code_block_2 = CodeBlock { "Revision"; }
contains = String.Contains(str=name_2, searchFor=code_block_2)
filterByBoolMask = List.FilterByBoolMask(list=builtInCategories.Categories, mask=contains)
element_types = ElementTypes("RevisionCloud")

# group: archi-lab
get_documents = Custom[Get Documents]()  # Queries all linked Revit files and retrieves their Name, LinkInstance and Document properties.

python_script_5 = Python(IN[0]=get_documents.Link_Doc)
# ---------- python_script_5.python (41 lines) ----------
#Copyright(c) 2015, Konrad Sobon
# @arch_laboratory, http://archi-lab.net

# This node is based on Julien Benoit's Element.GetElementFromLinkedFile 
# node. Some slight improvements were made removing unnecessary imports/references.
# Big thank you to Julien for sharing his work. 

import clr
clr.AddReference('ProtoGeometry')
from Autodesk.DesignScript.Geometry import *

# Import RevitAPI
clr.AddReference("RevitAPI")
import Autodesk
from Autodesk.Revit.DB import *

import System

import sys
pyt_path = r'C:\Program Files (x86)\IronPython 2.7\Lib'
sys.path.append(pyt_path)

#The inputs to this node will be stored as a list in the IN variable.
dataEnteringNode = IN

_linkDoc = IN[0]

try:
	errorReport = None
	result = FilteredElementCollector(_linkDoc[0]).OfCategory(BuiltInCategory.OST_Revisions).WhereElementIsNotElementType().ToElements()
	
except:
	# if error accurs anywhere in the process catch it
	import traceback
	errorReport = traceback.format_exc()

#Assign your output to the OUT variable
if errorReport == None:
	OUT = result
else:
	OUT = errorReport
# ----------------------------------------
name_3 = Element.Name(python_script_5)
categories = Categories()
python_script_6 = Python(IN[0]=python_script_5)
# ---------- python_script_6.python (30 lines) ----------
# Copyright(c) 2015, Konrad K Sobon
# @arch_laboratory, http://archi-lab.net

import clr
# Import Element wrapper extension methods
clr.AddReference("RevitNodes")
import Revit
clr.ImportExtensions(Revit.Elements)

# Import DocumentManager and TransactionManager
clr.AddReference("RevitServices")
import RevitServices
from RevitServices.Persistence import DocumentManager
doc = DocumentManager.Instance.CurrentDBDocument

# Import RevitAPI
clr.AddReference("RevitAPI")
import Autodesk
from Autodesk.Revit.DB import *

import sys
pyt_path = r'C:\Program Files (x86)\IronPython 2.7\Lib'
sys.path.append(pyt_path)

#The inputs to this node will be stored as a list in the IN variable.
dataEnteringNode = IN
rev = IN[0]


OUT = rev[0].Name, rev[0].RevisionDate, rev[0].RevisionNumber
# ----------------------------------------
