# Dynamo graph copyRevisions01.dyn (Dynamo 1.3.1.1736)

python_script = Python()  # frozen; unwired: IN[0]
# ---------- python_script.python (41 lines) ----------
# Copyright(c) 2015, Konrad K Sobon
# @arch_laboratory, http://archi-lab.net

import clr
# Import Element wrapper extension methods
clr.AddReference("RevitNodes")
import Revit
clr.ImportExtensions(Revit.Elements)

# Import DocumentManager and TransactionManager
clr.AddReference("RevitServices")
import RevitServices
from RevitServices.Persistence import DocumentManager
doc = DocumentManager.Instance.CurrentDBDocument

# Import RevitAPI
clr.AddReference("RevitAPI")
import Autodesk
from Autodesk.Revit.DB import *

clr.AddReference("System")
from System.Collections.Generic import List

import sys
pyt_path = r'C:\Program Files (x86)\IronPython 2.7\Lib'
sys.path.append(pyt_path)

result = FilteredElementCollector(doc).OfCategory(BuiltInCategory.OST_Revisions).WhereElementIsNotElementType().ToElements()

revId = []

for r in result:
	revId.append(r.Id)

revIds = List[ElementId](revId)



Revision.ReorderRevisionSequence(doc, revId)

OUT = result
# ----------------------------------------
name = Element.Name(python_script)

# group: archi-lab
get_documents = Custom[Get Documents]()  # Queries all linked Revit files and retrieves their Name, LinkInstance and Document properties.

# group: Select revision in linked file
python_script_2 = Python(IN[0]=get_documents.Link_Doc)
# ---------- python_script_2.python (41 lines) ----------
#Copyright(c) 2015, Konrad Sobon
# @arch_laboratory, http://archi-lab.net

# This node is based on Julien Benoit's Element.GetElementFromLinkedFile 
# node. Some slight improvements were made removing unnecessary imports/references.
# Big thank you to Julien for sharing his work. 

import clr
clr.AddReference('ProtoGeometry')
from Autodesk.DesignScript.Geometry import *

# Import RevitAPI
clr.AddReference("RevitAPI")
import Autodesk
from Autodesk.Revit.DB import *

import System

import sys
pyt_path = r'C:\Program Files (x86)\IronPython 2.7\Lib'
sys.path.append(pyt_path)

#The inputs to this node will be stored as a list in the IN variable.
dataEnteringNode = IN

_linkDoc = IN[0]

try:
	errorReport = None
	result = FilteredElementCollector(_linkDoc[0]).OfCategory(BuiltInCategory.OST_Revisions).WhereElementIsNotElementType().ToElements()
	
except:
	# if error accurs anywhere in the process catch it
	import traceback
	errorReport = traceback.format_exc()

#Assign your output to the OUT variable
if errorReport == None:
	OUT = result
else:
	OUT = errorReport
# ----------------------------------------

restOfItems = List.RestOfItems(python_script_2)

# group: get element name
python_script_3 = Python(IN[0]=restOfItems)
# ---------- python_script_3.python (34 lines) ----------
# Copyright(c) 2015, Konrad K Sobon
# @arch_laboratory, http://archi-lab.net

import clr
# Import Element wrapper extension methods
clr.AddReference("RevitNodes")
import Revit
clr.ImportExtensions(Revit.Elements)

# Import DocumentManager and TransactionManager
clr.AddReference("RevitServices")
import RevitServices
from RevitServices.Persistence import DocumentManager
doc = DocumentManager.Instance.CurrentDBDocument

# Import RevitAPI
clr.AddReference("RevitAPI")
import Autodesk
from Autodesk.Revit.DB import *

import sys
pyt_path = r'C:\Program Files (x86)\IronPython 2.7\Lib'
sys.path.append(pyt_path)

#The inputs to this node will be stored as a list in the IN variable.
dataEnteringNode = IN
rev = IN[0]

name = []

for r in rev:
	name.append(r.Name)

OUT = name
# ----------------------------------------

getFromLinkedFile = Custom[Element.GetFromLinkedFile](Link_Instance=get_documents.Link_Instance, Link_Document=get_documents.Link_Doc)  # Get elements from link document instance based on category; unwired: Category
categories = Categories("Walls")
python_script_4 = Python()  # unwired: IN[0]; same code as python_script_2

# group: Reorder sequence
python_script_5 = Python(IN[0]=get_documents.Link_Doc)
# ---------- python_script_5.python (41 lines) ----------
# Copyright(c) 2015, Konrad K Sobon
# @arch_laboratory, http://archi-lab.net

import clr
# Import Element wrapper extension methods
clr.AddReference("RevitNodes")
import Revit
clr.ImportExtensions(Revit.Elements)

# Import DocumentManager and TransactionManager
clr.AddReference("RevitServices")
import RevitServices
from RevitServices.Persistence import DocumentManager
doc = DocumentManager.Instance.CurrentDBDocument

# Import RevitAPI
clr.AddReference("RevitAPI")
import Autodesk
from Autodesk.Revit.DB import *

clr.AddReference("System")
from System.Collections.Generic import List

import sys
pyt_path = r'C:\Program Files (x86)\IronPython 2.7\Lib'
sys.path.append(pyt_path)

lyncDoc = IN[0]

allRevisions = Revision.GetAllRevisionIds(doc)
linkedRevisions = Revision.GetAllRevisionIds(lyncDoc[0])


newOrder = [linkedRevisions,allRevisions[0]]

#revIds = List[ElementId]()


#Revision.ReorderRevisionSequence(doc, revIds)

OUT = allRevisions, linkedRevisions, newOrder
# ----------------------------------------

code_block = CodeBlock(a=python_script_5) { a[0]; }

# group (continued): Reorder sequence
python_script_6 = Python(IN[0]=code_block)
# ---------- python_script_6.python (39 lines) ----------
# Copyright(c) 2015, Konrad K Sobon
# @arch_laboratory, http://archi-lab.net

import clr
# Import Element wrapper extension methods
clr.AddReference("RevitNodes")
import Revit
clr.ImportExtensions(Revit.Elements)

# Import DocumentManager and TransactionManager
clr.AddReference("RevitServices")
import RevitServices
from RevitServices.Persistence import DocumentManager
from RevitServices.Transactions import TransactionManager
doc = DocumentManager.Instance.CurrentDBDocument

# Import RevitAPI
clr.AddReference("RevitAPI")
import Autodesk
from Autodesk.Revit.DB import *

clr.AddReference("System")
from System.Collections.Generic import List

import sys
pyt_path = r'C:\Program Files (x86)\IronPython 2.7\Lib'
sys.path.append(pyt_path)


revId = IN[0]

TransactionManager.Instance.EnsureInTransaction(doc)

Revision.ReorderRevisionSequence(doc, revId)
result = FilteredElementCollector(doc).OfCategory(BuiltInCategory.OST_Revisions).WhereElementIsNotElementType().ToElements()

TransactionManager.Instance.TransactionTaskDone()

OUT = result
# ----------------------------------------
name_2 = Element.Name(python_script_6)

# group: copy revision in current doc and change order
python_script_7 = Python(IN[1]=restOfItems)  # unwired: IN[0]
# ---------- python_script_7.python (57 lines) ----------
import clr

clr.AddReference("RevitServices")
import RevitServices
from RevitServices.Persistence import DocumentManager
from RevitServices.Transactions import TransactionManager
doc = DocumentManager.Instance.CurrentDBDocument

clr.AddReference("RevitAPI")
import Autodesk
from Autodesk.Revit.DB import *

clr.AddReference("RevitNodes")
import Revit
clr.ImportExtensions(Revit.Elements)
clr.ImportExtensions(Revit.GeometryConversion)

clr.AddReference("System")
from System.Collections.Generic import List

linkDoc = UnwrapElement(IN[0])
rev = UnwrapElement(IN[1])

revId = []

for r in rev:
	revId.append(r.Id)

revIds = List[ElementId](revId)

allRevisions = Revision.GetAllRevisionIds(doc)

copiedElements = []

copyIds = []

for c in copiedElements:
	copyIds.append(c.Id)

newOrder = copyIds

newOrder.Insert(0,allRevisions[0])


TransactionManager.Instance.EnsureInTransaction(doc)

copy = ElementTransformUtils.CopyElements(linkDoc[0],revIds,doc,Transform.Identity,None)

for c in copy:
		copiedElements.append(doc.GetElement(c).ToDSType(True))

#Revision.ReorderRevisionSequence(doc,newOrder)

TransactionManager.Instance.TransactionTaskDone()


OUT = copiedElements, newOrder, copyIds
# ----------------------------------------

code_block_2 = CodeBlock(a=python_script_7) { a[0]; }
python_script_8 = Python(IN[0]=code_block_2)  # same code as python_script_3
python_script_9 = Python()  # unwired: IN[0]
# ---------- python_script_9.python (37 lines) ----------
# Copyright(c) 2015, Konrad K Sobon
# @arch_laboratory, http://archi-lab.net

import clr
# Import Element wrapper extension methods
clr.AddReference("RevitNodes")
import Revit
clr.ImportExtensions(Revit.Elements)

# Import DocumentManager and TransactionManager
clr.AddReference("RevitServices")
import RevitServices
from RevitServices.Persistence import DocumentManager
doc = DocumentManager.Instance.CurrentDBDocument

# Import RevitAPI
clr.AddReference("RevitAPI")
import Autodesk
from Autodesk.Revit.DB import *

clr.AddReference("System")
from System.Collections.Generic import List

import sys
pyt_path = r'C:\Program Files (x86)\IronPython 2.7\Lib'
sys.path.append(pyt_path)



allRevisions = Revision.GetAllRevisionIds(doc)

#revIds = List[ElementId]()


#Revision.ReorderRevisionSequence(doc, revIds)

OUT = allRevisions
# ----------------------------------------
id = Element.Id(code_block_2)
addItemToFront = List.AddItemToFront(item=python_script_9, list=id)
flatten = Flatten(addItemToFront)
python_script_10 = Python(IN[0]=flatten)  # same code as python_script_6

# group: Reorder sequence
python_script_11 = Python()  # unwired: IN[0]
# ---------- python_script_11.python (38 lines) ----------
# Copyright(c) 2015, Konrad K Sobon
# @arch_laboratory, http://archi-lab.net

import clr
# Import Element wrapper extension methods
clr.AddReference("RevitNodes")
import Revit
clr.ImportExtensions(Revit.Elements)

# Import DocumentManager and TransactionManager
clr.AddReference("RevitServices")
import RevitServices
from RevitServices.Persistence import DocumentManager
doc = DocumentManager.Instance.CurrentDBDocument

# Import RevitAPI
clr.AddReference("RevitAPI")
import Autodesk
from Autodesk.Revit.DB import *

clr.AddReference("System")
from System.Collections.Generic import List

import sys
pyt_path = r'C:\Program Files (x86)\IronPython 2.7\Lib'
sys.path.append(pyt_path)

lyncDoc = IN[0]

allRevisions = Revision.GetAllRevisionIds(doc)


#revIds = List[ElementId]()


#Revision.ReorderRevisionSequence(doc, revIds)

OUT = allRevisions
# ----------------------------------------
python_script_12 = Python(IN[0]=python_script_11)
# ---------- python_script_12.python (48 lines) ----------
# Copyright(c) 2015, Konrad K Sobon
# @arch_laboratory, http://archi-lab.net

import clr
# Import Element wrapper extension methods
clr.AddReference("RevitNodes")
import Revit
clr.ImportExtensions(Revit.Elements)

# Import DocumentManager and TransactionManager
clr.AddReference("RevitServices")
import RevitServices
from RevitServices.Persistence import DocumentManager
from RevitServices.Transactions import TransactionManager
doc = DocumentManager.Instance.CurrentDBDocument

# Import RevitAPI
clr.AddReference("RevitAPI")
import Autodesk
from Autodesk.Revit.DB import *

clr.AddReference("System")
from System.Collections.Generic import List

import sys
pyt_path = r'C:\Program Files (x86)\IronPython 2.7\Lib'
sys.path.append(pyt_path)


rev = IN[0]

revId = []

for r in rev:
	revId.append(r.Id)

element_collection = List[ElementId](rev)
elements_to_hide = collector.WhereElementIsNotElementType().Excluding(element_collection).ToElements()


TransactionManager.Instance.EnsureInTransaction(doc)

#Revision.ReorderRevisionSequence(doc, revId)
#result = FilteredElementCollector(doc).OfCategory(BuiltInCategory.OST_Revisions).WhereElementIsNotElementType().ToElements()
#result = FilteredElementCollector(doc).OfCategory(BuiltInCategory.OST_Revisions).WhereElementIsNotElementType()
TransactionManager.Instance.TransactionTaskDone()

OUT = revId
# ----------------------------------------
name_3 = Element.Name(python_script_12)

code_block_3 = CodeBlock { {a,2224657,2224658,2224659}; }  # unwired: a
code_block_4 = CodeBlock { {86155,2224673,2224674}; }
flatten_2 = Flatten(code_block_4)
element_types = ElementTypes("Revision")
all_elements_of_type = ElementsOfType(element_types)
type = Object.Type(all_elements_of_type)
python_script_13 = Python(IN[0]=python_script_11)
# ---------- python_script_13.python (48 lines) ----------
# Copyright(c) 2015, Konrad K Sobon
# @arch_laboratory, http://archi-lab.net

import clr
# Import Element wrapper extension methods
clr.AddReference("RevitNodes")
import Revit
clr.ImportExtensions(Revit.Elements)

# Import DocumentManager and TransactionManager
clr.AddReference("RevitServices")
import RevitServices
from RevitServices.Persistence import DocumentManager
from RevitServices.Transactions import TransactionManager
doc = DocumentManager.Instance.CurrentDBDocument

# Import RevitAPI
clr.AddReference("RevitAPI")
import Autodesk
from Autodesk.Revit.DB import *

clr.AddReference("System")
from System.Collections.Generic import List

import sys
pyt_path = r'C:\Program Files (x86)\IronPython 2.7\Lib'
sys.path.append(pyt_path)


rev = IN[0]

for r in rev:
    id = ElementId(r)
    element = doc.GetElement(id)
    element_set = ElementSet()
    element_set.Insert(element)

element_collection = List[ElementId](element_set)
elements_to_hide = collector.WhereElementIsNotElementType().Excluding(element_collection).ToElements()

TransactionManager.Instance.EnsureInTransaction(doc)

#Revision.ReorderRevisionSequence(doc, revId)
#result = FilteredElementCollector(doc).OfCategory(BuiltInCategory.OST_Revisions).WhereElementIsNotElementType().ToElements()
#result = FilteredElementCollector(doc).OfCategory(BuiltInCategory.OST_Revisions).WhereElementIsNotElementType()
TransactionManager.Instance.TransactionTaskDone()

OUT = rev
# ----------------------------------------

# group: copy revision
python_script_14 = Python(IN[1]=python_script_2)  # unwired: IN[0]
# ---------- python_script_14.python (42 lines) ----------
import clr

clr.AddReference("RevitServices")
import RevitServices
from RevitServices.Persistence import DocumentManager
from RevitServices.Transactions import TransactionManager
doc = DocumentManager.Instance.CurrentDBDocument

clr.AddReference("RevitAPI")
import Autodesk
from Autodesk.Revit.DB import *

clr.AddReference("RevitNodes")
import Revit
clr.ImportExtensions(Revit.Elements)
clr.ImportExtensions(Revit.GeometryConversion)

clr.AddReference("System")
from System.Collections.Generic import List

linkDoc = UnwrapElement(IN[0])
rev = UnwrapElement(IN[1])

revId = []

for r in rev:
	revId.append(r.Id)

revIds = List[ElementId](revId)

copiedElements = []
#The inputs to this node will be stored as a list in the IN variable.
TransactionManager.Instance.EnsureInTransaction(doc)

copy = Autodesk.Revit.DB.ElementTransformUtils.CopyElements(linkDoc[0],revIds,doc,None,None)

for c in copy:
	#copiedElements.append(doc.GetElement(c).ToDSType(True))
	copiedElements.append(doc.GetElement(c))
TransactionManager.Instance.TransactionTaskDone()

OUT = copiedElements
# ----------------------------------------

type_2 = Object.Type(python_script_14)

# group: get element name
python_script_15 = Python(IN[0]=python_script_14)  # same code as python_script_3

type_3 = Object.Type(code_block)
select_model_element = DSModelElementSelection()  # 1 picked in the model
reverse = List.Reverse(all_elements_of_type)
python_script_16 = Python(IN[0]=reverse)
# ---------- python_script_16.python (39 lines) ----------
# Copyright(c) 2015, Konrad K Sobon
# @arch_laboratory, http://archi-lab.net

import clr
# Import Element wrapper extension methods
clr.AddReference("RevitNodes")
import Revit
clr.ImportExtensions(Revit.Elements)

# Import DocumentManager and TransactionManager
clr.AddReference("RevitServices")
import RevitServices
from RevitServices.Persistence import DocumentManager
from RevitServices.Transactions import TransactionManager
doc = DocumentManager.Instance.CurrentDBDocument

# Import RevitAPI
clr.AddReference("RevitAPI")
import Autodesk
from Autodesk.Revit.DB import *

clr.AddReference("System")
from System.Collections.Generic import List

import sys
pyt_path = r'C:\Program Files (x86)\IronPython 2.7\Lib'
sys.path.append(pyt_path)


rev = IN[0]

revId = []

for r in rev:
	revId.append(ElementId(r.Id))

revIds = List[ElementId](revId)

OUT = revIds
# ----------------------------------------
type_4 = Object.Type(python_script_16)
python_script_17 = Python(IN[0]=reverse)
# ---------- python_script_17.python (35 lines) ----------
# Copyright(c) 2015, Konrad K Sobon
# @arch_laboratory, http://archi-lab.net

import clr
# Import Element wrapper extension methods
clr.AddReference("RevitNodes")
import Revit
clr.ImportExtensions(Revit.Elements)

# Import DocumentManager and TransactionManager
clr.AddReference("RevitServices")
import RevitServices
from RevitServices.Persistence import DocumentManager
from RevitServices.Transactions import TransactionManager
doc = DocumentManager.Instance.CurrentDBDocument

# Import RevitAPI
clr.AddReference("RevitAPI")
import Autodesk
from Autodesk.Revit.DB import *

clr.AddReference("System")
from System.Collections.Generic import List

import sys
pyt_path = r'C:\Program Files (x86)\IronPython 2.7\Lib'
sys.path.append(pyt_path)


rev = IN[0]
ids = []
for r in rev:
	ids.append(ElementId(r.Id))

OUT = ids
# ----------------------------------------
python_script_18 = Python(IN[0]=python_script_17)  # same code as python_script_6
select_model_element_2 = DSModelElementSelection()  # 1 picked in the model
python_script_19 = Python(IN[0]=select_model_element_2)
# ---------- python_script_19.python (34 lines) ----------
# Copyright(c) 2015, Konrad K Sobon
# @arch_laboratory, http://archi-lab.net

import clr
# Import Element wrapper extension methods
clr.AddReference("RevitNodes")
import Revit
clr.ImportExtensions(Revit.Elements)

# Import DocumentManager and TransactionManager
clr.AddReference("RevitServices")
import RevitServices
from RevitServices.Persistence import DocumentManager
from RevitServices.Transactions import TransactionManager
doc = DocumentManager.Instance.CurrentDBDocument

# Import RevitAPI
clr.AddReference("RevitAPI")
import Autodesk
from Autodesk.Revit.DB import *

clr.AddReference("System")
from System.Collections.Generic import List

import sys
pyt_path = r'C:\Program Files (x86)\IronPython 2.7\Lib'
sys.path.append(pyt_path)


selElement = UnwrapElement(IN[0])

id = selElement.Id 

OUT = id
# ----------------------------------------
type_5 = Object.Type(python_script_19)
