# Dynamo graph copyRevisions02.dyn (Dynamo 1.3.1.1736)

python_script = Python()  # unwired: IN[0]
# ---------- python_script.python (36 lines) ----------
# Copyright(c) 2015, Konrad K Sobon
# @arch_laboratory, http://archi-lab.net

import clr
# Import Element wrapper extension methods
clr.AddReference("RevitNodes")
import Revit
clr.ImportExtensions(Revit.Elements)

# Import DocumentManager and TransactionManager
clr.AddReference("RevitServices")
import RevitServices
from RevitServices.Persistence import DocumentManager
doc = DocumentManager.Instance.CurrentDBDocument

# Import RevitAPI
clr.AddReference("RevitAPI")
import Autodesk
from Autodesk.Revit.DB import *

clr.AddReference("System")
from System.Collections.Generic import List

import sys
pyt_path = r'C:\Program Files (x86)\IronPython 2.7\Lib'
sys.path.append(pyt_path)


allRevisions = Revision.GetAllRevisionIds(doc)

#revIds = List[ElementId]()


#Revision.ReorderRevisionSequence(doc, revIds)

OUT = allRevisions
# ----------------------------------------
code_block = CodeBlock(a=python_script) { a[0]; }
element_types = ElementTypes("Revision")
all_elements_of_type = ElementsOfType(element_types)
name = Element.Name(all_elements_of_type)
id = Element.Id(all_elements_of_type)
python_script_2 = Python(IN[0]=id)  # frozen
# ---------- python_script_2.python (39 lines) ----------
# Copyright(c) 2015, Konrad K Sobon
# @arch_laboratory, http://archi-lab.net

import clr
# Import Element wrapper extension methods
clr.AddReference("RevitNodes")
import Revit
clr.ImportExtensions(Revit.Elements)

# Import DocumentManager and TransactionManager
clr.AddReference("RevitServices")
import RevitServices
from RevitServices.Persistence import DocumentManager
from RevitServices.Transactions import TransactionManager
doc = DocumentManager.Instance.CurrentDBDocument

# Import RevitAPI
clr.AddReference("RevitAPI")
import Autodesk
from Autodesk.Revit.DB import *

clr.AddReference("System")
from System.Collections.Generic import List

import sys
pyt_path = r'C:\Program Files (x86)\IronPython 2.7\Lib'
sys.path.append(pyt_path)


revId = IN[0]

TransactionManager.Instance.EnsureInTransaction(doc)

try:
	OUT = Revision.ReorderRevisionSequence(doc, revId)
except Exception, e:
	OUT = str(e)

TransactionManager.Instance.TransactionTaskDone()
# ----------------------------------------
watch = Custom[Springs.Watch+](input=python_script_2)  # This node that serializes the input information and presents it in a resizable text window.
code_block_2 = CodeBlock(a=all_elements_of_type) { Flatten({a[0],a[4..5]}); }
id_2 = Element.Id(code_block_2)
reverse = List.Reverse(id_2)
python_script_3 = Python(IN[0]=reverse)
# ---------- python_script_3.python (38 lines) ----------
# Copyright(c) 2015, Konrad K Sobon
# @arch_laboratory, http://archi-lab.net

import clr
# Import Element wrapper extension methods
clr.AddReference("RevitNodes")
import Revit
clr.ImportExtensions(Revit.Elements)

# Import DocumentManager and TransactionManager
clr.AddReference("RevitServices")
import RevitServices
from RevitServices.Persistence import DocumentManager
from RevitServices.Transactions import TransactionManager
doc = DocumentManager.Instance.CurrentDBDocument

# Import RevitAPI
clr.AddReference("RevitAPI")
import Autodesk
from Autodesk.Revit.DB import *

clr.AddReference("System")
from System.Collections.Generic import List

import sys
pyt_path = r'C:\Program Files (x86)\IronPython 2.7\Lib'
sys.path.append(pyt_path)


revId = IN[0]

TransactionManager.Instance.EnsureInTransaction(doc)

Revision.ReorderRevisionSequence(doc, revId)

TransactionManager.Instance.TransactionTaskDone()

OUT = "done"
# ----------------------------------------
name_2 = Element.Name(code_block_2)
