# Dynamo graph copyRevisions03.dyn (Dynamo 1.3.1.1736)

# note: [1] allRevisionsEl = FilteredElementCollector(doc).OfCategory(BuiltInCategory.OST_Revisions).WhereElementIsNotElementType().ToElements()

restOfItems = List.RestOfItems()  # unwired: arg0
python_script = Python(IN[0]=restOfItems)
# ---------- python_script.python (39 lines) ----------
# Copyright(c) 2015, Konrad K Sobon
# @arch_laboratory, http://archi-lab.net

import clr
# Import Element wrapper extension methods
clr.AddReference("RevitNodes")
import Revit
clr.ImportExtensions(Revit.Elements)

# Import DocumentManager and TransactionManager
clr.AddReference("RevitServices")
import RevitServices
from RevitServices.Persistence import DocumentManager
from RevitServices.Transactions import TransactionManager
doc = DocumentManager.Instance.CurrentDBDocument

# Import RevitAPI
clr.AddReference("RevitAPI")
import Autodesk
from Autodesk.Revit.DB import *


rev= UnwrapElement(IN[0])

ids = []
issue = []
nextRevsion = []

for r in rev:
	ids.append(r.Id)
	issue.append(r.Issued)

TransactionManager.Instance.EnsureInTransaction(doc)

#nextRevsion = Revision.CombineWithNext(doc, ids[0])

TransactionManager.Instance.TransactionTaskDone()

OUT = ids, issue, nextRevsion
# ----------------------------------------
code_block = CodeBlock(a=python_script) { a[0]; }
restOfItems_2 = List.RestOfItems(code_block)
reverse = List.Reverse(restOfItems_2)
restOfItems_3 = List.RestOfItems(reverse)

# group: Reorder sequence
# note: [0] allRevisionsIds = Revision.GetAllRevisionIds(doc)
python_script_2 = Python()  # unwired: IN[0]
# ---------- python_script_2.python (35 lines) ----------
# Copyright(c) 2015, Konrad K Sobon
# @arch_laboratory, http://archi-lab.net

import clr
# Import Element wrapper extension methods
clr.AddReference("RevitNodes")
import Revit
clr.ImportExtensions(Revit.Elements)

# Import DocumentManager and TransactionManager
clr.AddReference("RevitServices")
import RevitServices
from RevitServices.Persistence import DocumentManager
doc = DocumentManager.Instance.CurrentDBDocument

# Import RevitAPI
clr.AddReference("RevitAPI")
import Autodesk
from Autodesk.Revit.DB import *

clr.AddReference("System")
from System.Collections.Generic import List

import sys
pyt_path = r'C:\Program Files (x86)\IronPython 2.7\Lib'
sys.path.append(pyt_path)


allRevisionsIds = Revision.GetAllRevisionIds(doc)

allRevisionsEl = FilteredElementCollector(doc).OfCategory(BuiltInCategory.OST_Revisions).WhereElementIsNotElementType().ToElements()



OUT = allRevisionsIds, allRevisionsEl
# ----------------------------------------
python_script_3 = Python(IN[0]=restOfItems_3)
# ---------- python_script_3.python (33 lines) ----------
# Copyright(c) 2015, Konrad K Sobon
# @arch_laboratory, http://archi-lab.net

import clr
# Import Element wrapper extension methods
clr.AddReference("RevitNodes")
import Revit
clr.ImportExtensions(Revit.Elements)

# Import DocumentManager and TransactionManager
clr.AddReference("RevitServices")
import RevitServices
from RevitServices.Persistence import DocumentManager
from RevitServices.Transactions import TransactionManager
doc = DocumentManager.Instance.CurrentDBDocument

# Import RevitAPI
clr.AddReference("RevitAPI")
import Autodesk
from Autodesk.Revit.DB import *


revId = UnwrapElement(IN[0])

TransactionManager.Instance.EnsureInTransaction(doc)

Revision.ReorderRevisionSequence(doc, revId)

allRevisionsEl = FilteredElementCollector(doc).OfCategory(BuiltInCategory.OST_Revisions).WhereElementIsNotElementType().ToElements()

TransactionManager.Instance.TransactionTaskDone()

OUT = allRevisionsEl
# ----------------------------------------

code_block_2 = CodeBlock(a=python_script_2) { a[1]; }
code_block_3 = CodeBlock(a=python_script_2) { a[0]; }
name = Element.Name(python_script_3)
type = Object.Type(restOfItems_2)
python_script_4 = Python()  # unwired: IN[0]; same code as python_script_2
code_block_4 = CodeBlock(a=python_script_4) { a[1]; }
python_script_5 = Python(IN[0]=code_block_4)
# ---------- python_script_5.python (39 lines) ----------
# Copyright(c) 2015, Konrad K Sobon
# @arch_laboratory, http://archi-lab.net

import clr
# Import Element wrapper extension methods
clr.AddReference("RevitNodes")
import Revit
clr.ImportExtensions(Revit.Elements)

# Import DocumentManager and TransactionManager
clr.AddReference("RevitServices")
import RevitServices
from RevitServices.Persistence import DocumentManager
from RevitServices.Transactions import TransactionManager
doc = DocumentManager.Instance.CurrentDBDocument

# Import RevitAPI
clr.AddReference("RevitAPI")
import Autodesk
from Autodesk.Revit.DB import *


rev= UnwrapElement(IN[0])


issue = []
nextRevsion = []




TransactionManager.Instance.EnsureInTransaction(doc)

for i in range(0,len(rev)-1):
	nextRevsion = Revision.CombineWithNext(doc, rev[i].Id)
#	issue.append(rev[i].Issued)
TransactionManager.Instance.TransactionTaskDone()

OUT = issue, nextRevsion
# ----------------------------------------
reverse_2 = List.Reverse(restOfItems)

# group: Revision in the linked file
code_block_5 = CodeBlock(a=python_script_2) { a[1]; }

restOfItems_4 = List.RestOfItems(code_block_5)
name_2 = Element.Name(restOfItems_4)
revisionDate = Revision.RevisionDate(restOfItems_4)
revisiondescription_python = Python(IN[0]=restOfItems_4)  # "RevisionDescription : Python Script"
# ---------- revisiondescription_python.python (31 lines) ----------
# Copyright(c) 2015, Konrad K Sobon
# @arch_laboratory, http://archi-lab.net

import clr
# Import Element wrapper extension methods
clr.AddReference("RevitNodes")
import Revit
clr.ImportExtensions(Revit.Elements)

# Import DocumentManager and TransactionManager
clr.AddReference("RevitServices")
import RevitServices
from RevitServices.Persistence import DocumentManager
from RevitServices.Transactions import TransactionManager
doc = DocumentManager.Instance.CurrentDBDocument

# Import RevitAPI
clr.AddReference("RevitAPI")
import Autodesk
from Autodesk.Revit.DB import *


rev= UnwrapElement(IN[0])

description = []

for r in rev:
	description.Add(r.Description)


OUT = description
# ----------------------------------------
issued = Revision.Issued(restOfItems_4)
issuedBy = Revision.IssuedBy(restOfItems_4)
issuedTo = Revision.IssuedTo(restOfItems_4)
byName = Revision.ByName(name_2, revisionDate, revisiondescription_python, issued, issuedBy, issuedTo)
setIssued = Revision.SetIssued()  # unwired: arg0, arg1
name_3 = Element.Name(code_block_4)
code_block_6 = CodeBlock { "-1"; }
contains = String.Contains(str=name_3, searchFor=code_block_6)
filterByBoolMask = List.FilterByBoolMask(list=code_block_4, mask=contains)
code_block_7 = CodeBlock {  }
