# Dynamo graph viewTitle08.dyn (Dynamo 0.8.2.2392)

viewport_properties = Custom[Viewport Properties]()  # This node will return certain properties from a Viewport input.
get_all_viewport_types = Custom[Get All Viewport Types]()  # This node will retrieve all Viewport Types currently in the model.
name = Element.Name(get_all_viewport_types)
code_block = CodeBlock { 1; }
views = Custom[Document.Views](toggle=code_block)  # Gets all views in the document - except for 3D view templates (as long as this bug is not fixed: https://github.com/DynamoDS/Dynamo/issues/2970)
family = FamilySymbol.Family(views)
name_2 = FamilySymbol.Name(views)
name_3 = Family.Name()
symbols = Family.Symbols()
code_block_2 = CodeBlock { "Title"; }
code_block_3 = CodeBlock(a=get_all_viewport_types) { a[1]; }
all_elements_of_type = ElementsOfType(code_block_3)
code_block_4 = CodeBlock(a=all_elements_of_type) { a; }
string = StringInput("C:\Users\giovanni.brogiolo\Desktop\views.csv")
code_block_5 = CodeBlock { 1; }
viewports = Custom[Collector.Viewports](RunMe=code_block_5)  # This collects all of the viewports in the model and outputs the name, title on sheet, scale and viewport type.
python_script = Python(IN[0]=viewports.Elements)
# ---------- python_script.python (40 lines) ----------
# Copyright(c) 2015, Konrad K Sobon
# @arch_laboratory, http://archi-lab.net

import clr
clr.AddReference('ProtoGeometry')
from Autodesk.DesignScript.Geometry import *

# Import DocumentManager and TransactionManager
clr.AddReference("RevitServices")
import RevitServices
from RevitServices.Persistence import DocumentManager
doc = DocumentManager.Instance.CurrentDBDocument

# Import RevitAPI
clr.AddReference("RevitAPI")
import Autodesk
from Autodesk.Revit.DB import *

import sys
pyt_path = r'C:\Program Files (x86)\IronPython 2.7\Lib'
sys.path.append(pyt_path)

#The inputs to this node will be stored as a list in the IN variable.
dataEnteringNode = IN



elements = UnwrapElement(IN[0])



elemType = []

for e in elements:
	try:
		elemType.append(doc.GetElement(e.GetTypeId()))
	except:
		""
		
OUT = elemType
# ----------------------------------------
name_4 = Element.Name()
groupByKey = GroupByKey(python_script, name_4)
name_5 = Element.Name(groupByKey)
writeToFile = CSV.WriteToFile(string, name_5)
viewports_2 = Custom[Collector.Viewports](RunMe=code_block_5)
sortByKey = SortByKey()
code_block_6 = CodeBlock(a=groupByKey) { a[5][0]; }
indexOf = IndexOf(python_script, code_block_6)
getItemAtIndex = List.GetItemAtIndex(list=viewports.Elements, index=indexOf)
parameters = Element.Parameters(getItemAtIndex)
