# Dynamo graph viewportType.dyn (Dynamo 1.3.1.1736)

categories = Categories("Viewports")
all_elements_of_category = ElementsOfCategory(categories)
ownerView = Custom[Element.OwnerView](element=all_elements_of_category)  # Gets the owner view of a given Revit element (if possible)
python_script = Python(IN[0]=all_elements_of_category)
# ---------- python_script.python (10 lines) ----------
import clr
clr.AddReference('RevitAPI')
from Autodesk.Revit.DB import *

views = UnwrapElement(IN[0])
elementlist = list()

for view in views:
	elementlist.append(str(view.ViewId))
OUT = elementlist
# ----------------------------------------
toNumber = String.ToNumber(python_script)
byId = WombatDynamo.Element.ById(toNumber)
type = Custom[View.Type](view=byId)  # Returns the type of a given view
view_type = ViewTypesUi("EngineeringPlan")
eq = type == view_type
filterByBoolMask = List.FilterByBoolMask(list=all_elements_of_category, mask=eq)
categories_2 = Categories("Sheets")
all_elements_of_category_2 = ElementsOfCategory(categories_2)
getViewportsAndViews = RevitElements.Sheet.GetViewportsAndViews(all_elements_of_category_2)
code_block = CodeBlock { 0; }
getItemAtIndex = List.GetItemAtIndex(list=getViewportsAndViews.out0, index=code_block, lacing=Longest)
removeNulls = Lists.Manage.RemoveNulls(getItemAtIndex)
type_2 = Custom[View.Type](view=getViewportsAndViews.out1@L2)
uniqueItems = List.UniqueItems(type_2, lacing=Longest)
view_type_2 = ViewTypesUi("EngineeringPlan")
eq_2 = uniqueItems == view_type_2
removeItemAtIndex = List.RemoveItemAtIndex(list=eq_2, indices=removeNulls.out1)
flatten = Flatten(removeItemAtIndex)
filterByBoolMask_2 = List.FilterByBoolMask(list=removeNulls.out0, mask=flatten)
