# Dynamo graph Volume.dyn (Dynamo 0.8.2.2392)

name = Parameter.Name()
code_block = CodeBlock { "Wall"; }
contains = String.Contains(str=name, searchFor=code_block)
filterByBoolMask = List.FilterByBoolMask(mask=contains)
volume_from_elements = Custom[Volume from elements](Element=filterByBoolMask.in)
count = Count(filterByBoolMask.in)
string_from_object = FromObject(filterByBoolMask.out)
code_block_2 = CodeBlock { "Floor"; }
contains_2 = String.Contains(str=string_from_object, searchFor=code_block_2)
filterByBoolMask_2 = List.FilterByBoolMask(list=filterByBoolMask.out, mask=contains_2)
volume_from_elements_2 = Custom[Volume from elements](Element=filterByBoolMask_2.in)
count_2 = Count(filterByBoolMask_2.in)
count_3 = Count(filterByBoolMask_2.out)
volume_from_elements_3 = Custom[Volume from elements](Element=filterByBoolMask_2.out)
select_model_elements = DSModelElementsSelection()  # 4 picked in the model
solids = Element.Solids(select_model_elements)
flatten = Flatten(solids)
bv_remove_nulls = Custom[bv Remove Nulls](List=flatten)  # forked from Lunchbox
volume = Solid.Volume(bv_remove_nulls)
code_block_3 = CodeBlock { 1000000000; }
div = volume / code_block_3
sum = Math.Sum(div)
watch = Custom[Watch+]()  # This node that serializes the input information and presents it in a resizable text window.
