# Dynamo graph WallSections (1).dyn (Dynamo 1.2.1.3083)

code_block = CodeBlock {  }
select_model_elements = DSModelElementsSelection()  # 17 picked in the model
getCategory = Element.GetCategory(select_model_elements)
string_from_object = FromObject(getCategory)
code_block_2 = CodeBlock(x=string_from_object) { x=="Walls"; }
filterByBoolMask = List.FilterByBoolMask(list=select_model_elements, mask=code_block_2)
parameters = Element.Parameters(filterByBoolMask.in)
getLocation = Element.GetLocation(filterByBoolMask.in)
code_block_3 = CodeBlock { 0.5; }
pointAtParameter = Curve.PointAtParameter(curve=getLocation, param=code_block_3)
startPoint = Curve.StartPoint(getLocation)
endPoint = Curve.EndPoint(getLocation)
byTwoPoints = Vector.ByTwoPoints(start=startPoint, end=endPoint)
ZAxis = Vector.ZAxis()
byOriginVectors = CoordinateSystem.ByOriginVectors(origin=pointAtParameter, xAxis=byTwoPoints, yAxis=ZAxis)
length = Curve.Length(getLocation)
buffer = CodeBlock { 50; }
code_block_4 = CodeBlock(len=length, buffer=buffer) { len+buffer; }
boundingBox = Element.BoundingBox(filterByBoolMask.in)
maxPoint = BoundingBox.MaxPoint(boundingBox)
code_block_5 = CodeBlock(p2=maxPoint, p1=startPoint) { p2.Z-p1.Z; }
type = Custom[Element.Type](element=filterByBoolMask.in)  # Gets the family type of a given element (if applicable).
code_block_6 = CodeBlock { "Width"; }
getParameterValueByName = Element.GetParameterValueByName(element=type, parameterName=code_block_6)
code_block_7 = CodeBlock(x=code_block_4, buffer=buffer, h=code_block_5, width=getParameterValueByName, lacing=Longest) { {-x/2-buffer,x/2+buffer}; {h-h-buffer,h+buffer}; {-width/2-buffer,width/2+buffer}; }
byCoordinates = Point.ByCoordinates(x=code_block_7.out0, y=code_block_7.out1, z=code_block_7.out2)
code_block_8 = CodeBlock(p=byCoordinates) { p[0]; p[1]; }
byCoordinateSystemMinPointMaxPoint = SectionView.ByCoordinateSystemMinPointMaxPoint(byOriginVectors, code_block_8.out0, code_block_8.out1, lacing=Longest)
code_block_9 = CodeBlock { "View Name"; }
prefix = CodeBlock { "CL"; }
id = Element.Id(filterByBoolMask.in)
code_block_10 = CodeBlock(level=prefix, id=id) { level+"_"+id; }
setParameterByName = Element.SetParameterByName(element=byCoordinateSystemMinPointMaxPoint, parameterName=code_block_9, value=code_block_10)
id_2 = Element.Id()  # unwired: arg0
