# Dynamo graph Select walls.dyn (Dynamo 0.8.2.2392)

categories = Categories("Walls")
all_elements_of_category = ElementsOfCategory(categories)
code_block = CodeBlock { "Base Constraint"; }
getParameterValueByName = Element.GetParameterValueByName(element=all_elements_of_category, parameterName=code_block)
code_block_2 = CodeBlock { "Top Constraint"; }
getParameterValueByName_2 = Element.GetParameterValueByName(element=all_elements_of_category, parameterName=code_block_2)
string_from_object = FromObject(getParameterValueByName_2)

# group: INPUT: LEVEL
code_block_3 = CodeBlock { "B06"; }

code_block_4 = CodeBlock { true; }
contains = String.Contains(str=string_from_object, searchFor=code_block_3, ignoreCase=code_block_4)
filterByBoolMask = List.FilterByBoolMask(list=all_elements_of_category, mask=contains)
id = Element.Id(filterByBoolMask.in)
string_from_array = FromArray(id)
watch = Custom[Watch+](input=string_from_array)  # This node that serializes the input information and presents it in a resizable text window.
