# Dynamo graph Wall Attach.dyn (Dynamo 1.2.0.2514)

code_block = CodeBlock { "Top is Attached"; }
code_block_2 = CodeBlock { "Top"; }
listBuiltInParametersByName = Custom[Document.ListBuiltInParametersByName](searchFor=code_block_2)  # Looks up all the built-in parameters based on a given name (or part of a name) of the parameters. Search is case-insensitive.
select_model_element = DSModelElementSelection()  # 1 picked in the model
get_builtinparameter_name = ItemSelector("Top is Attached | WALL_TOP_IS_ATTACHED | YesNo | ReadOnly", select_model_element)
levels = Levels("04")
python_script = Python(IN[0]=get_builtinparameter_name, IN[1]=select_model_element, IN[2]=levels)
# ---------- python_script.python (81 lines) ----------
#Copyright(c) 2015, Konrad K Sobon
# @arch_laboratory, http://archi-lab.net

import clr
import sys
clr.AddReference('ProtoGeometry')
from Autodesk.DesignScript.Geometry import *

pyt_path = r'C:\Program Files (x86)\IronPython 2.7\Lib'
sys.path.append(pyt_path)

# Import Element wrapper extension methods
clr.AddReference("RevitNodes")
import Revit
clr.ImportExtensions(Revit.Elements)

# Import DocumentManager and TransactionManager
clr.AddReference("RevitServices")
import RevitServices
from RevitServices.Persistence import DocumentManager
from RevitServices.Transactions import TransactionManager

doc = DocumentManager.Instance.CurrentDBDocument
uiapp = DocumentManager.Instance.CurrentUIApplication
app = uiapp.Application

# Import RevitAPI
clr.AddReference("RevitAPI")
import Autodesk
from Autodesk.Revit.DB import *
import System

#The inputs to this node will be stored as a list in the IN variable.
dataEnteringNode = IN

paramName = IN[0]
paramValues = IN[2]

if isinstance(IN[1], list):
	elements = []
	for i in IN[1]:
		elements.append(UnwrapElement(i))
else:
	elements = IN[1]



def GetBuiltInParam(paramName):
	builtInParams = System.Enum.GetValues(BuiltInParameter)
	test = []
	for i in builtInParams:
		if i.ToString() == paramName:
			test.append(i)
			break
		else:
			continue
	return test[0]


try:
	errorReport = None
	# "Start" the transaction
	TransactionManager.Instance.EnsureInTransaction(doc)
	
	bipName = GetBuiltInParam(paramName)
	
	param = elements.get_Parameter(bipName)
	param.Set(paramValues[0])
	
	# "End" the transaction
	TransactionManager.Instance.TransactionTaskDone()
except:
	# if error accurs anywhere in the process catch it
	import traceback
	errorReport = traceback.format_exc()

#Assign your output to the OUT variable
if errorReport == None:
	OUT = 0
else:
	OUT = errorReport
# ----------------------------------------
