# Dynamo custom node Wall Penetration Zones.dyf (Dynamo 1.3.0.875)
# category: Test
# Identify the zones where penetration can be placed

get_revit_activeview = Custom[Get Revit ActiveView]()  # Active View
element = Input(element : Element)
faces = Element.Faces(element)
area = Surface.Area(faces)
maximumItem = List.MaximumItem(area)
eq = area == maximumItem
filterByBoolMask = List.FilterByBoolMask(list=faces, mask=eq)
flatten = Flatten(filterByBoolMask.in)
V_Subdivisions = Input()

# group: V subdivisions
code_block = CodeBlock(a=V_Subdivisions) { 0..1..#a; }

H_Subdivisions = Input()
code_block_2 = CodeBlock(b=H_Subdivisions) { (0..0.125..#b); (0.875..1..#b); (0.125..0.250..#b); (0.750..0.875..#b); (0.25..0.75..#b); }
code_block_3 = CodeBlock(a=code_block_2.out0, b=code_block_2.out1, c=code_block_2.out2, d=code_block_2.out3, e=code_block_2.out4) { {a,b,c,d,e}; }
flatten_2 = Flatten(code_block_3)
pointAtParameter = Surface.PointAtParameter(surface=flatten, u=code_block, v=flatten_2, lacing=CrossProduct)
transpose = List.Transpose(pointAtParameter, lacing=Longest)
flatten_3 = Flatten(transpose)
code_block_4 = CodeBlock { {1,1,2,2,4,1,1,2,2,4}; }
code_block_5 = CodeBlock(a=V_Subdivisions, b=H_Subdivisions) { a*b; }
cycle = List.Cycle(list=code_block_4, amount=code_block_5, lacing=Longest)
flatten_4 = Flatten(cycle)
count = List.Count(element)
cycle_2 = List.Cycle(list=flatten_4, amount=count)
code_block_6 = CodeBlock { "Penetration Zoning"; "Red No, Orange TBC"; null; }
byViewPointsAndValues = Revit.AnalysisDisplay.PointAnalysisDisplay.ByViewPointsAndValues(get_revit_activeview, flatten_3, cycle_2, code_block_6.out0, code_block_6.out1, code_block_6.out2)
PointAnalysisDisplay = Output(byViewPointsAndValues)
