# Dynamo graph Wall Split at Floor test.dyn (Dynamo 1.2.0.2514)

# group: SELECT WALL
select_model_element = DSModelElementSelection()

location = Custom[Element.Location](element=select_model_element)  # Returns the location of an element as an XYZ (or if it's line-based the start and end point of the line), along with some booleans to help filtering the results. Use this for some element types (e.g. walls or lines) that do not work with the built-in Get Family Instance Location node.

# group: SELECT FLOORS (WALL BASE FLOOR EXCLUDED)
select_model_elements = DSModelElementsSelection()  # 2 picked in the model

geometry = Element.Geometry(select_model_elements)
centroid = Solid.Centroid(geometry)
code_block = CodeBlock(a=centroid) { a.Z; }
code_block_2 = CodeBlock { "Thickness"; }
getParameterValueByName = Element.GetParameterValueByName(element=select_model_elements, parameterName=code_block_2)
code_block_3 = CodeBlock(a=code_block, b=getParameterValueByName) { a+b/2; }
flatten = Flatten(code_block_3)
flatten_2 = Flatten(code_block)
sortByKey = List.SortByKey(list=flatten, keys=flatten_2)
watch = Watch(sortByKey.sorted_list)
python_script = Python(IN[0]=location.curves, IN[1]=watch)
# ---------- python_script.python (25 lines) ----------
import clr
clr.AddReference('ProtoGeometry')
from Autodesk.DesignScript.Geometry import *
#The inputs to this node will be stored as a list in the IN variables.

lines = UnwrapElement(IN[0])

ptZ = UnwrapElement(IN[1])

StartPt= []

EndPt = []

newLn = []

for pt in lines:
	for zcoord in ptZ:
		StartPt.append(Point.ByCoordinates(pt.StartPoint.X,pt.StartPoint.Y,zcoord))
		EndPt.append(Point.ByCoordinates(pt.EndPoint.X,pt.EndPoint.Y,zcoord))

for i in range (0,len(StartPt)):
	newLn.append(Line.ByStartPointEndPoint(StartPt[i],EndPt[i]))

#Assign your output to the OUT variable.
OUT = newLn
# ----------------------------------------
python_script_2 = Python(IN[0]=watch)
# ---------- python_script_2.python (14 lines) ----------
import clr
clr.AddReference('ProtoGeometry')
from Autodesk.DesignScript.Geometry import *
#The inputs to this node will be stored as a list in the IN variables.

numbers = UnwrapElement(IN[0])
difference = []

for i in range (0,len(numbers)-1):
	difference.append(numbers[i+1]-numbers[i])


#Assign your output to the OUT variable.
OUT = difference
# ----------------------------------------
flatten_3 = Flatten(python_script_2)
element_types = ElementTypes("Level")
all_elements_of_type = ElementsOfType(element_types)
code_block_4 = CodeBlock { 1; }
dropItems = List.DropItems(list=all_elements_of_type, amount=code_block_4)
python_script_3 = Python(IN[0]=select_model_element)
# ---------- python_script_3.python (18 lines) ----------
import clr
clr.AddReference('RevitAPI')
from Autodesk.Revit.DB import *

items = UnwrapElement(IN[0])
typelist = list()


"""
for i in range (0,len(items)):
	try: 
		typelist.append(item[i].Document.GetElement(item[i].GetTypeId()))
	except:
		typelist.append(list())
"""


OUT = items.Document.GetElement(items.GetTypeId())
# ----------------------------------------
byCurveAndHeight = Wall.ByCurveAndHeight(curve=python_script, height=flatten_3, level=dropItems, wallType=python_script_3)
create = List.Create(select_model_element, byCurveAndHeight)
code_block_5 = CodeBlock { "Top Constraint"; }
setParameterByName = Element.SetParameterByName(element=create, parameterName=code_block_5, value=dropItems)
code_block_6 = CodeBlock { 2; }
dropItems_2 = List.DropItems(list=all_elements_of_type, amount=code_block_6)
