# Dynamo graph Wall Split at Floor v8.dyn (Dynamo 0.8.2.2392)

code_block = CodeBlock { "Top Constraint"; }
element_types = ElementTypes("Level")
all_elements_of_type = ElementsOfType(element_types)
code_block_2 = CodeBlock { 1; }
dropItems = List.DropItems(list=all_elements_of_type, amount=code_block_2)
setParameterByName = Element.SetParameterByName(parameterName=code_block, value=dropItems)

# group: SELECT WALL
select_model_element = DSModelElementSelection()  # 1 picked in the model

location = Custom[Element.Location](element=select_model_element)  # Returns the location of an element as an XYZ (or if it's line-based the start and end point of the line), along with some booleans to help filtering the results. Use this for some element types (e.g. walls or lines) that do not work with the built-in Get Family Instance Location node.

# group: SELECT FLOORS (WALL BASE FLOOR EXCLUDED)
select_model_elements = DSModelElementsSelection()

geometry = Element.Geometry(select_model_elements)
centroid = Solid.Centroid(geometry)
code_block_3 = CodeBlock(a=centroid) { a.Z; }
flatten = Flatten(code_block_3)
code_block_4 = CodeBlock { "Thickness"; }
getParameterValueByName = Element.GetParameterValueByName(element=select_model_elements, parameterName=code_block_4)
code_block_5 = CodeBlock(a=flatten, b=getParameterValueByName) { a+b/2; }
sort = List.Sort(code_block_5)
new_lines = Python(IN[0]=location.curves, IN[1]=sort)
# ---------- new_lines.python (25 lines) ----------
import clr
clr.AddReference('ProtoGeometry')
from Autodesk.DesignScript.Geometry import *
#The inputs to this node will be stored as a list in the IN variables.

lines = UnwrapElement(IN[0])

ptZ = UnwrapElement(IN[1])

StartPt= []

EndPt = []

newLn = []

for pt in lines:
	for zcoord in ptZ:
		StartPt.append(Point.ByCoordinates(pt.StartPoint.X,pt.StartPoint.Y,zcoord))
		EndPt.append(Point.ByCoordinates(pt.EndPoint.X,pt.EndPoint.Y,zcoord))

for i in range (0,len(StartPt)):
	newLn.append(Line.ByStartPointEndPoint(StartPt[i],EndPt[i]))

#Assign your output to the OUT variable.
OUT = newLn
# ----------------------------------------
python_script = Python(IN[0]=sort)
# ---------- python_script.python (14 lines) ----------
import clr
clr.AddReference('ProtoGeometry')
from Autodesk.DesignScript.Geometry import *
#The inputs to this node will be stored as a list in the IN variables.

numbers = UnwrapElement(IN[0])
difference = []

for i in range (0,len(numbers)-1):
	difference.append(numbers[i+1]-numbers[i])


#Assign your output to the OUT variable.
OUT = difference
# ----------------------------------------
flatten_2 = Flatten(python_script)
get_wall_type = Python(IN[0]=select_model_element)
# ---------- get_wall_type.python (18 lines) ----------
import clr
clr.AddReference('RevitAPI')
from Autodesk.Revit.DB import *

items = UnwrapElement(IN[0])
typelist = list()


"""
for i in range (0,len(items)):
	try: 
		typelist.append(item[i].Document.GetElement(item[i].GetTypeId()))
	except:
		typelist.append(list())
"""


OUT = items.Document.GetElement(items.GetTypeId())
# ----------------------------------------
byCurveAndHeight = Wall.ByCurveAndHeight(curve=new_lines, height=flatten_2, level=dropItems, wallType=get_wall_type)
create = List.Create(select_model_element, byCurveAndHeight)
flatten_3 = Flatten(create)
geometry_2 = Element.Geometry(select_model_elements)
element_types_2 = ElementTypes("Level")
all_elements_of_type_2 = ElementsOfType(element_types_2)
elevation = Level.Elevation(all_elements_of_type_2)
all_elements_at_level = ElementsAtLevel()
all_elements_of_family_type = ElementsOfFamilyType()
