# Dynamo graph Wall Split at Floor.dyn (Dynamo 1.2.0.2514)

categories = Categories("Walls")
all_elements_of_category = ElementsOfCategory(categories)
watch = Watch(all_elements_of_category)
parameters = Element.Parameters(all_elements_of_category)
geometry = Element.Geometry(all_elements_of_category)
XY = Plane.XY()
intersect = Geometry.Intersect(geometry=geometry, other=XY)
flatten = Flatten(intersect)
perimeterCurves = Surface.PerimeterCurves(flatten)
length = Curve.Length(perimeterCurves)
minimumItem = List.MinimumItem(length)
eq = _ == minimumItem  # unwired: arg0; lacing=CrossProduct
map = List.Map(list=length, f_x=eq)
filterByBoolMask = List.FilterByBoolMask(list=perimeterCurves, mask=map)
code_block = CodeBlock { 0.5; }
pointAtParameter = Curve.PointAtParameter(curve=filterByBoolMask.in, param=code_block)
transpose = List.Transpose(pointAtParameter)
code_block_2 = CodeBlock(l=transpose) { l[0]; l[1]; }
byStartPointEndPoint = Line.ByStartPointEndPoint(startPoint=code_block_2.out0, endPoint=code_block_2.out1)
element_types = ElementTypes("Level")
all_elements_of_type = ElementsOfType(element_types)
code_block_3 = CodeBlock { 0..1; 1; }
sublists = List.Sublists(list=all_elements_of_type, ranges=code_block_3.out0, offset=code_block_3.out1)
restOfItems = List.RestOfItems(sublists)
code_block_4 = CodeBlock { -1; }
dropItems = List.DropItems(list=restOfItems, amount=code_block_4)
transpose_2 = List.Transpose(dropItems)
code_block_5 = CodeBlock(w=transpose_2) { w[0]; w[1]; }
name = WallType.Name(all_elements_of_category)
byName = WallType.ByName(name)
byCurveAndLevels = Wall.ByCurveAndLevels(arg1=code_block_5.out0, arg2=code_block_5.out1, arg3=byName)  # unwired: arg0
map_2 = List.Map(list=byStartPointEndPoint, f_x=byCurveAndLevels)
code_block_6 = CodeBlock { "Top Constraint"; }
firstItem = List.FirstItem(sublists)
code_block_7 = CodeBlock(f=firstItem) { f[1]; }
setParameterByName = Element.SetParameterByName(element=all_elements_of_category, parameterName=code_block_6, value=code_block_7)

# group: SELECT WALL
select_model_element = DSModelElementSelection()  # 1 picked in the model

location = Custom[Element.Location](element=select_model_element)  # Returns the location of an element as an XYZ (or if it's line-based the start and end point of the line), along with some booleans to help filtering the results. Use this for some element types (e.g. walls or lines) that do not work with the built-in Get Family Instance Location node.

# group: SELECT FLOORS (WALL BASE FLOOR EXCLUDED)
select_model_elements = DSModelElementsSelection()  # 2 picked in the model

geometry_2 = Element.Geometry(select_model_elements)
centroid = Solid.Centroid(geometry_2)
code_block_8 = CodeBlock(a=centroid) { a.Z; }
code_block_9 = CodeBlock { "Thickness"; }
getParameterValueByName = Element.GetParameterValueByName(element=select_model_elements, parameterName=code_block_9)
code_block_10 = CodeBlock(a=code_block_8, b=getParameterValueByName) { a+b/2; }
flatten_2 = Flatten(code_block_10)
flatten_3 = Flatten(code_block_8)
sortByKey = List.SortByKey(list=flatten_2, keys=flatten_3)
watch_2 = Watch(sortByKey.sorted_list)
python_script = Python(IN[0]=location.curves, IN[1]=watch_2)
# ---------- python_script.python (25 lines) ----------
import clr
clr.AddReference('ProtoGeometry')
from Autodesk.DesignScript.Geometry import *
#The inputs to this node will be stored as a list in the IN variables.

lines = UnwrapElement(IN[0])

ptZ = UnwrapElement(IN[1])

StartPt= []

EndPt = []

newLn = []

for pt in lines:
	for zcoord in ptZ:
		StartPt.append(Point.ByCoordinates(pt.StartPoint.X,pt.StartPoint.Y,zcoord))
		EndPt.append(Point.ByCoordinates(pt.EndPoint.X,pt.EndPoint.Y,zcoord))

for i in range (0,len(StartPt)):
	newLn.append(Line.ByStartPointEndPoint(StartPt[i],EndPt[i]))

#Assign your output to the OUT variable.
OUT = newLn
# ----------------------------------------
python_script_2 = Python(IN[0]=watch_2)
# ---------- python_script_2.python (14 lines) ----------
import clr
clr.AddReference('ProtoGeometry')
from Autodesk.DesignScript.Geometry import *
#The inputs to this node will be stored as a list in the IN variables.

numbers = UnwrapElement(IN[0])
difference = []

for i in range (0,len(numbers)-1):
	difference.append(numbers[i+1]-numbers[i])


#Assign your output to the OUT variable.
OUT = difference
# ----------------------------------------
flatten_4 = Flatten(python_script_2)
element_types_2 = ElementTypes("Level")
all_elements_of_type_2 = ElementsOfType(element_types_2)
code_block_11 = CodeBlock { 1; }
dropItems_2 = List.DropItems(list=all_elements_of_type_2, amount=code_block_11)
python_script_3 = Python(IN[0]=select_model_element)
# ---------- python_script_3.python (18 lines) ----------
import clr
clr.AddReference('RevitAPI')
from Autodesk.Revit.DB import *

items = UnwrapElement(IN[0])
typelist = list()


"""
for i in range (0,len(items)):
	try: 
		typelist.append(item[i].Document.GetElement(item[i].GetTypeId()))
	except:
		typelist.append(list())
"""


OUT = items.Document.GetElement(items.GetTypeId())
# ----------------------------------------
byCurveAndHeight = Wall.ByCurveAndHeight(curve=python_script, height=flatten_4, level=dropItems_2, wallType=python_script_3)
code_block_12 = CodeBlock { "Top Constraint"; }
code_block_13 = CodeBlock { 2; }
dropItems_3 = List.DropItems(list=all_elements_of_type_2, amount=code_block_13)
setParameterByName_2 = Element.SetParameterByName(element=byCurveAndHeight, parameterName=code_block_12, value=dropItems_3)
# note: Select Element to be Joined
select_model_elements_2 = DSModelElementsSelection()
getJoinedElements = Custom[Element.GetJoinedElements](element=select_model_elements_2)  # This will obtain the elements joined to the input element.
select_model_element_2 = DSModelElementSelection()

# group: JOIN Based on Clockwork Element.JoinGeometry
python_script_4 = Python()  # unwired: IN[0]
# ---------- python_script_4.python (32 lines) ----------
import clr
clr.AddReference('RevitAPI')
from Autodesk.Revit.DB import *
from System.Collections.Generic import *
clr.AddReference("RevitServices")
import RevitServices
from RevitServices.Persistence import DocumentManager
from RevitServices.Transactions import TransactionManager

doc = DocumentManager.Instance.CurrentDBDocument

#The inputs to this node will be stored as a list in the IN variables.
dataEnteringNode = IN

items1 = UnwrapElement(IN[0])


TransactionManager.Instance.EnsureInTransaction(doc)
booleans=[]

for i in range (0,len(items1)):
	for j in range(0,len(items1[i])):
		try:
			JoinGeometryUtils.JoinGeometry(doc,items1[i][0],items1[i][j])
			booleans.append(True)
		except:
			booleans.append(False)

TransactionManager.Instance.TransactionTaskDone()

#Assign your output to the OUT variable.
OUT = booleans
# ----------------------------------------

# group: UNJOIN Based on Clockwork Element.JoinGeometry
python_script_5 = Python()  # unwired: IN[0]
# ---------- python_script_5.python (32 lines) ----------
import clr
clr.AddReference('RevitAPI')
from Autodesk.Revit.DB import *
from System.Collections.Generic import *
clr.AddReference("RevitServices")
import RevitServices
from RevitServices.Persistence import DocumentManager
from RevitServices.Transactions import TransactionManager

doc = DocumentManager.Instance.CurrentDBDocument

#The inputs to this node will be stored as a list in the IN variables.
dataEnteringNode = IN

items1 = UnwrapElement(IN[0])


TransactionManager.Instance.EnsureInTransaction(doc)
booleans=[]

for i in range (0,len(items1)):
	for j in range(0,len(items1[i])):
		try:
			JoinGeometryUtils.UnjoinGeometry(doc,items1[i][0],items1[i][j])
			booleans.append(True)
		except:
			booleans.append(False)

TransactionManager.Instance.TransactionTaskDone()

#Assign your output to the OUT variable.
OUT = booleans
# ----------------------------------------

# group: GetJoinedElements Based on Clockwork Element.JoinGeometry
python_script_6 = Python(IN[0]=select_model_elements_2)
# ---------- python_script_6.python (32 lines) ----------
import clr
clr.AddReference('RevitAPI')
from Autodesk.Revit.DB import *
from System.Collections.Generic import *
clr.AddReference("RevitServices")
import RevitServices
from RevitServices.Persistence import DocumentManager
from RevitServices.Transactions import TransactionManager

doc = DocumentManager.Instance.CurrentDBDocument

#The inputs to this node will be stored as a list in the IN variables.
dataEnteringNode = IN

items1 = UnwrapElement(IN[0])


TransactionManager.Instance.EnsureInTransaction(doc)
booleans=[]
joinedlist=[]

for i in range (0,len(items1)):
	try:
		joinedlist.append(JoinGeometryUtils.GetJoinedElements(doc,items1[i]))
		booleans.append(True)
	except:
		booleans.append(False)

TransactionManager.Instance.TransactionTaskDone()

#Assign your output to the OUT variable.
OUT = joinedlist
# ----------------------------------------

# group: ARE ELEMENT JOINED?
python_script_7 = Python(IN[0]=python_script_6)
# ---------- python_script_7.python (30 lines) ----------
import clr
clr.AddReference('RevitAPI')
from Autodesk.Revit.DB import *
from System.Collections.Generic import *
clr.AddReference("RevitServices")
import RevitServices
from RevitServices.Persistence import DocumentManager
from RevitServices.Transactions import TransactionManager

doc = DocumentManager.Instance.CurrentDBDocument

#The inputs to this node will be stored as a list in the IN variables.
dataEnteringNode = IN

items1 = UnwrapElement(IN[0])


TransactionManager.Instance.EnsureInTransaction(doc)
booleans=[]

for i in range (0,len(items1)):
	if len(items1[i]) == 0:
		booleans.append(False)
	else:
		booleans.append(True)

TransactionManager.Instance.TransactionTaskDone()

#Assign your output to the OUT variable.
OUT = booleans
# ----------------------------------------

filterByBoolMask_2 = List.FilterByBoolMask(list=select_model_elements_2, mask=python_script_7)
watch_3 = Watch(filterByBoolMask_2.in)

# group: SWITCH JOIN ORDER Based on Clockwork Element.JoinGeometry
python_script_8 = Python()  # unwired: IN[0]
# ---------- python_script_8.python (32 lines) ----------
import clr
clr.AddReference('RevitAPI')
from Autodesk.Revit.DB import *
from System.Collections.Generic import *
clr.AddReference("RevitServices")
import RevitServices
from RevitServices.Persistence import DocumentManager
from RevitServices.Transactions import TransactionManager

doc = DocumentManager.Instance.CurrentDBDocument

#The inputs to this node will be stored as a list in the IN variables.
dataEnteringNode = IN

items1 = UnwrapElement(IN[0])


TransactionManager.Instance.EnsureInTransaction(doc)
booleans=[]

for i in range (0,len(items1)):
	for j in range(0,len(items1[i])):
		try:
			JoinGeometryUtils.SwitchJoinOrder(doc,items1[i][0],items1[i][j])
			booleans.append(True)
		except:
			booleans.append(False)

TransactionManager.Instance.TransactionTaskDone()

#Assign your output to the OUT variable.
OUT = booleans
# ----------------------------------------

# note: Select Element to be Joined to
select_model_elements_3 = DSModelElementsSelection()
code_block_14 = CodeBlock { 1; }

# group: SteamNodes
getSurroundingElements = Custom[Tool.GetSurroundingElements](Element=select_model_elements_2, ElementCheck=select_model_elements_3, Tolerance=code_block_14)  # Get Surrounding Elements by Categories, group them as List. Tolerance distance available.

count = List.Count()  # unwired: arg0
map_3 = List.Map(list=getSurroundingElements, f_x=count)
code_block_15 = CodeBlock { 1; }
gt = map_3 > code_block_15
filterByBoolMask_3 = List.FilterByBoolMask(list=getSurroundingElements, mask=gt)
watch_4 = Watch(filterByBoolMask_3.in)

# group: JOIN+SWITCH JOIN Based on Clockwork Element.JoinGeometry
python_script_9 = Python(IN[0]=watch_4)
# ---------- python_script_9.python (34 lines) ----------
import clr
clr.AddReference('RevitAPI')
from Autodesk.Revit.DB import *
from System.Collections.Generic import *
clr.AddReference("RevitServices")
import RevitServices
from RevitServices.Persistence import DocumentManager
from RevitServices.Transactions import TransactionManager

doc = DocumentManager.Instance.CurrentDBDocument

#The inputs to this node will be stored as a list in the IN variables.
dataEnteringNode = IN

items1 = UnwrapElement(IN[0])


TransactionManager.Instance.EnsureInTransaction(doc)
booleans=[]

for i in range (0,len(items1)):
	for j in range(0,len(items1[i])):
		try:
			JoinGeometryUtils.JoinGeometry(doc,items1[i][0],items1[i][j])
			JoinGeometryUtils.SwitchJoinOrder(doc,items1[i][0],items1[i][j])
			booleans.append(True)
		except:
			booleans.append(False)


TransactionManager.Instance.TransactionTaskDone()

#Assign your output to the OUT variable.
OUT = booleans
# ----------------------------------------

watch_5 = Watch(filterByBoolMask_2.out)
