# Dynamo graph WallsColouring01.dyn (Dynamo 1.3.0.875)

get_revit_activeview = Custom[Get Revit ActiveView]()  # Active View
select_model_elements = DSModelElementsSelection()  # 2 picked in the model
faces = Element.Faces(select_model_elements)
area = Surface.Area(faces)
maximumItem = List.MaximumItem(area)
eq = area == maximumItem
filterByBoolMask = List.FilterByBoolMask(list=faces, mask=eq)
code_block = CodeBlock { 10; }

# group: V subdivisions
code_block_2 = CodeBlock(a=code_block) { 0..1..#a; }

# group: H subdivisions
code_block_3 = CodeBlock { 10; }

code_block_4 = CodeBlock(b=code_block_3) { (0..0.125..#b); (0.875..1..#b); (0.125..0.250..#b); (0.750..0.875..#b); }
code_block_5 = CodeBlock(a=code_block_4.out0, b=code_block_4.out1, c=code_block_4.out2, d=code_block_4.out3) { {a,b,c,d}; }
flatten = Flatten(code_block_5)
pointAtParameter = Surface.PointAtParameter(surface=filterByBoolMask.in, u=code_block_2, v=flatten, lacing=CrossProduct)
transpose = List.Transpose(pointAtParameter, lacing=Longest)
flatten_2 = Flatten(transpose)
code_block_6 = CodeBlock { {1,1,2,2,1,1,2,2}; }
code_block_7 = CodeBlock(a=code_block, b=code_block_3) { a*b; }
cycle = List.Cycle(list=code_block_6, amount=code_block_7, lacing=Longest)
flatten_3 = Flatten(cycle)
code_block_8 = CodeBlock { "Penetration Zoning"; "Red No, Orange TBC"; null; }
byViewPointsAndValues = Revit.AnalysisDisplay.PointAnalysisDisplay.ByViewPointsAndValues(get_revit_activeview, flatten_2, flatten_3, code_block_8.out0, code_block_8.out1, code_block_8.out2)
