# Dynamo graph WallsColouring04.dyn (Dynamo 1.3.1.1736)

select_model_elements = DSModelElementsSelection()  # 3 picked in the model
code_block = CodeBlock { 10; }
wall_penetration_zones = Custom[Wall Penetration Zones](element=select_model_elements, H_Subdivisions=code_block, V_Subdivisions=code_block)  # Identify the zones where penetration can be placed
get_revit_activeview = Custom[Get Revit ActiveView]()  # Active View
code_block_2 = CodeBlock { "Penetration Zoning"; }
categories = Categories("AnalysisDisplayStyle")
all_elements_of_category = ElementsOfCategory(categories)
setParameterByName = Element.SetParameterByName(element=get_revit_activeview, parameterName=code_block_2, value=all_elements_of_category)
