# Dynamo graph placeWindows.dyn (Dynamo 1.3.1.1736)

# group: from Bakery
get_loaded_rvt_links = Custom[Get Loaded RVT Links]()

categories = Categories("CurtainWallPanels")

# group: from SteamNodes
getFromLinkedFile = Custom[Element.GetFromLinkedFile](Link_Instance=get_loaded_rvt_links.loaded_Link_Names, Link_Document=get_loaded_rvt_links.loaded_Link_Docs, Category=categories)  # Get elements from link document instance based on category

parameters = Element.Parameters(getFromLinkedFile)
code_block = CodeBlock { {"S.O. _ Width","S.O. _ Height"}; }
getParameterValueByName = Element.GetParameterValueByName(element=getFromLinkedFile, parameterName=code_block, lacing=CrossProduct)
code_block_2 = CodeBlock { 0; }
round = Math.Round(number=getParameterValueByName, digits=code_block_2)

# group: alternative way
code_block_3 = CodeBlock { {"Rough Width", "Rough Height"}; }
setParameterByName = Element.SetParameterByName(parameterName=code_block_3, lacing=Longest)  # unwired: element, value
levels = Levels()
byPointAndLevel = FamilyInstance.ByPointAndLevel(level=levels)  # unwired: familyType, point
select_model_elements = DSModelElementsSelection()  # 9 picked in the model
name = Element.Name()  # unwired: arg0
groupByFunction = GroupByFunction(select_model_elements@L1, name)

select_model_element = DSModelElementSelection()
family_types = FamilyTypes()
boundaries = CurtainPanel.Boundaries(getFromLinkedFile)
curves = PolyCurve.Curves(boundaries@L1)
endPoint = Curve.EndPoint(curves)
byPoints = Polygon.ByPoints(endPoint)
center = Polygon.Center(byPoints)
code_block_4 = CodeBlock { 140-3040/2; }
translate = Geometry.Translate(geometry=center, zTranslation=code_block_4)
byPoints_2 = Custom[Springs.HostedInstance.ByPoints](host=select_model_element, type=family_types, point=translate)  # Creates hosted family instances(doors/windows) at the specified points. You can feed either a single family type or a unique type for each instance.
subComponents = Custom[FamilyInstance.SubComponents](familyInstance=select_model_elements)  # Retrieves all subcomponents of a given family instance
flatten = Flatten(subComponents)
location = FamilyInstance.Location(flatten)
