# Dynamo graph placeWindows02.dyn (Dynamo 1.3.1.1736)

# group: Select Wall
select_model_element = DSModelElementSelection()

# group: Select Void type
family_types = FamilyTypes()

# group: from Bakery
get_loaded_rvt_links = Custom[Get Loaded RVT Links]()

categories = Categories("Windows")

# group: from SteamNodes
getFromLinkedFile = Custom[Element.GetFromLinkedFile](Link_Document=get_loaded_rvt_links.loaded_Link_Docs, Category=categories)  # Get elements from link document instance based on category; unwired: Link_Instance

# group: Extract windows void locations
subComponents = Custom[FamilyInstance.SubComponents](familyInstance=getFromLinkedFile)  # Retrieves all subcomponents of a given family instance
flatten = Flatten(subComponents)
location = FamilyInstance.Location(flatten)

# group: Place voids
byPoints = Custom[Springs.HostedInstance.ByPoints](host=select_model_element, type=family_types, point=location)  # Creates hosted family instances(doors/windows) at the specified points. You can feed either a single family type or a unique type for each instance.

# group: Extract windows void width and height
code_block = CodeBlock { {"S.O. _ Width","S.O. _ Height"}; }
getParameterValueByName = Element.GetParameterValueByName(element=getFromLinkedFile, parameterName=code_block, lacing=CrossProduct)
code_block_2 = CodeBlock { 0; }
round = Math.Round(number=getParameterValueByName, digits=code_block_2)

# group: Set void width and height
code_block_3 = CodeBlock { {"Void_Width","Void_height"}; }
setParameterByName = Element.SetParameterByName(element=byPoints, parameterName=code_block_3@L2, value=round, lacing=Longest)

# group: alternative way
levels = Levels()
byPointAndLevel = FamilyInstance.ByPointAndLevel(level=levels)  # unwired: familyType, point
select_model_elements = DSModelElementsSelection()
name = Element.Name()  # unwired: arg0
groupByFunction = GroupByFunction(select_model_elements, name)

subComponents_2 = Custom[FamilyInstance.SubComponents](familyInstance=select_model_elements)
flatten_2 = Flatten(subComponents_2)
code_block_4 = CodeBlock(A=groupByFunction) { A[1]; }
location_2 = FamilyInstance.Location(code_block_4)
host = Custom[Element.Host]()  # Gets an element's host; unwired: element
groupByFunction_2 = GroupByFunction(getFromLinkedFile, host)
family_types_2 = FamilyTypes()
byPointAndLevel_2 = FamilyInstance.ByPointAndLevel(familyType=family_types_2, level=levels)  # unwired: point
byPoint = FamilyInstance.ByPoint()  # unwired: familyType, point
host_2 = Custom[Element.Host]()  # unwired: element
host_3 = Custom[Element.Host](element=code_block_4)
code_block_5 = CodeBlock(a=groupByFunction) { a[1]; }
host_4 = Custom[Element.Host](element=code_block_5)
subComponents_3 = Custom[FamilyInstance.SubComponents](familyInstance=select_model_elements)
code_block_6 = CodeBlock(A=subComponents_3) { A[1]; }
