# Dynamo graph placeWindows04.dyn (Dynamo 1.3.1.1736)

get_linked_rvt_documents = Custom[Get Linked RVT Documents]()
code_block = CodeBlock(a=get_linked_rvt_documents.Link_Doc) { a[0]; }
linkedInstanceElements = Custom[Springs.Collector.LinkedInstanceElements]()  # Extract elements by category from the selected linked instances. The transform vector can be used to get the exact location of the elements in the local file; unwired: LinkInstance, category
family_types = FamilyTypes("Void Cut - Rectangular:Void Cut - Rectangular")
categories = Categories("Windows")
python_script = Python(IN[0]=get_linked_rvt_documents.Link_Instance, IN[1]=categories)  # unwired: IN[2]
# ---------- python_script.python (39 lines) ----------
#Copyright(c) 2016, Dimitar Venkov
# @5devene, dimitar.ven@gmail.com
#original design by Julien Benoit, @jbenoit44
# http://aecuandme.wordpress.com/

import clr
clr.AddReference('ProtoGeometry')
from Autodesk.DesignScript.Geometry import *

clr.AddReference("RevitNodes")
import Revit
clr.ImportExtensions(Revit.Elements)
clr.ImportExtensions(Revit.GeometryConversion)

clr.AddReference("RevitAPI")
import Autodesk
from Autodesk.Revit.DB import FilteredElementCollector, ElementCategoryFilter, XYZ

def tolist(obj1):
	if hasattr(obj1,"__iter__"): return obj1
	else: return [obj1]
def output1(l1):
	if len(l1) == 1: return l1[0]
	else: return l1

Link1 = UnwrapElement(tolist(IN[0]))
Cat1 = UnwrapElement(IN[1])
elements, transforms = [], []

for i in xrange(len(Link1)):
	LinkDoc = Link1[i].GetLinkDocument()
	fec = FilteredElementCollector(LinkDoc).OfCategoryId(Cat1.Id).WhereElementIsNotElementType()
	fec1 = [e.ToDSType(True) for e in fec]
	elements.append(fec1)
	tf1 = Link1[i].GetTransform()
	cs1 = CoordinateSystem.ByOriginVectors(tf1.Origin.ToPoint(True),
	tf1.BasisX.ToVector(True), tf1.BasisY.ToVector(True), tf1.BasisZ.ToVector(True))
	transforms.append(cs1)
OUT = output1(elements), output1(transforms)
# ----------------------------------------
code_block_2 = CodeBlock(a=python_script) { a[0]; }
name = Element.Name()  # unwired: arg0
groupByFunction = GroupByFunction(code_block_2, name)
code_block_3 = CodeBlock(a=groupByFunction) { a[0]; }
location = Custom[Element.Location](element=code_block_3)  # Returns the location of an element as an XYZ (or if it's line-based the start and end point of the line), along with some booleans to help filtering the results. Use this for some element types (e.g. walls or lines) that do not work with the built-in Get Family Instance Location node.
code_block_4 = CodeBlock(a=python_script) { a[1]; }
transform = Geometry.Transform(location.points, code_block_4)
byPoint = FamilyInstance.ByPoint(familyType=family_types, point=transform)
code_block_5 = CodeBlock { {"Height","Length"}; }
getType = FamilyInstance.GetType(code_block_3)
code_block_6 = CodeBlock { {"Width","Height"}; }
getParameterValueByName = Element.GetParameterValueByName(element=getType, parameterName=code_block_6, lacing=CrossProduct)
code_block_7 = CodeBlock { 0; }
round = Math.Round(number=getParameterValueByName, digits=code_block_7)
code_block_8 = CodeBlock(a=round) { a[0]; }
setParameterByName = Element.SetParameterByName(element=byPoint, parameterName=code_block_5, value=code_block_8@L2, lacing=Longest)
