# Dynamo graph placeWindows07.dyn (Dynamo 1.3.1.1736)

# group: SELECT STRUCTURAL WALLS
select_model_elements = DSModelElementsSelection()  # 2 picked in the model

# group: EXTRACT WINDOWS FROM LINKED FILE
get_linked_rvt_documents = Custom[Get Linked RVT Documents]()
categories = Categories("CurtainWallPanels")
linkedInstanceElements = Custom[Springs.Collector.LinkedInstanceElements](LinkInstance=get_linked_rvt_documents.Link_Instance, category=categories)  # Extract elements by category from the selected linked instances. The transform vector can be used to get the exact location of the elements in the local file

subComponents = Custom[FamilyInstance.SubComponents](familyInstance=linkedInstanceElements.elements)  # Retrieves all subcomponents of a given family instance
isEmpty = List.IsEmpty(subComponents, lacing=Longest)
filterByBoolMask = List.FilterByBoolMask(list=linkedInstanceElements.elements, mask=isEmpty)
code_block = CodeBlock(a=filterByBoolMask.out) { a; }

# group: INTERSECT WINDOWS WITH WALLS (BIMORPH NODE)
boundingBox = Geometry.BoundingBox(select_model_elements, lacing=Longest)
code_block_2 = CodeBlock { 0; }
getElementsIntersect = Revit.BoundingBox.GetElementsIntersect(boundingBox, code_block, code_block_2)

# group: FIND ARCH WINDOWS LOCATION POINTS AND PLACE OPENING
family_types = FamilyTypes("Window_void:void")
location = Custom[Element.Location](element=getElementsIntersect, lacing=Longest)  # Returns the location of an element as an XYZ (or if it's line-based the start and end point of the line), along with some booleans to help filtering the results. Use this for some element types (e.g. walls or lines) that do not work with the built-in Get Family Instance Location node.
byPoints = Custom[Springs.HostedInstance.ByPoints](host=select_model_elements, type=family_types, point=location.points, lacing=Longest)  # Creates hosted family instances(doors/windows) at the specified points. You can feed either a single family type or a unique type for each instance.

# group: GET ARCHITECTS'S WINDOWS WIDTH AND HEIGHT
getType = FamilyInstance.GetType(getElementsIntersect)
code_block_3 = CodeBlock { {"Width","Height"}; }
getParameterValueByName = Element.GetParameterValueByName(element=getType, parameterName=code_block_3, lacing=CrossProduct)
code_block_4 = CodeBlock { 0; }
round = Math.Round(number=getParameterValueByName, digits=code_block_4)

# group: SET OPENING WIDTH AND HEIGHT
code_block_5 = CodeBlock { "Void_Width"; }
code_block_6 = CodeBlock { 0; }
getItemAtIndex = List.GetItemAtIndex(list=round, index=code_block_6, lacing=Longest)
setParameterByName = Element.SetParameterByName(element=byPoints, parameterName=code_block_5, value=getItemAtIndex, lacing=Longest)
code_block_7 = CodeBlock { "Void_height"; }
code_block_8 = CodeBlock { 1; }
getItemAtIndex_2 = List.GetItemAtIndex(list=round, index=code_block_8, lacing=Longest)
setParameterByName_2 = Element.SetParameterByName(element=byPoints, parameterName=code_block_7, value=getItemAtIndex_2, lacing=Longest)

# group: ALTERNATIVE WAY TO EXTRACT WIDTH AND HEIGHT (NOT CONSISTENT)
string = StringInput("([\d.]+)")
name = Element.Name(getType)
findRegularExpression = Custom[String.FindRegularExpression](RegEx=string, str=name)  # Returns all occurences of a regular expression within a string (or list of strings). The syntax for regular expressions is explained at http://ironpython-test.readthedocs.org/en/latest/howto/regex.html
deconstruct = List.Deconstruct(list=findRegularExpression, lacing=Longest)
toNumber = String.ToNumber(deconstruct.rest)

flatten = Flatten(subComponents)

# group: EXAMPLE OF HOW TO GROUP WINDOWS BY THEIR NAME
name_2 = Element.Name()  # unwired: arg0
groupByFunction = GroupByFunction(flatten, name_2)
code_block_9 = CodeBlock(a=groupByFunction) { a[0]; }
boundingBox_2 = Geometry.BoundingBox(code_block_9)

intersects = BoundingBox.Intersects(boundingBox, boundingBox_2, lacing=Longest)
categories_2 = Categories("Windows")
linkedInstanceElements_2 = Custom[Springs.Collector.LinkedInstanceElements](LinkInstance=get_linked_rvt_documents.Link_Instance, category=categories_2)
boundingBox_3 = Geometry.BoundingBox(code_block)
intersects_2 = BoundingBox.Intersects(boundingBox, boundingBox_3, lacing=CrossProduct)
location_2 = Custom[Element.Location](element=flatten, lacing=Longest)
code_block_10 = CodeBlock(a=location_2.points) { a; }
flatten_2 = Flatten(code_block_10)
contains = BoundingBox.Contains(boundingBox, flatten_2, lacing=CrossProduct)
countTrue = CountTrue(contains, lacing=Longest)
