# Dynamo graph wallToRhino.dyn (Dynamo 1.3.1.1736)

file_path = Filename("..\Desktop\17.3dm")
boolean = BoolSelector(true)
code_block = CodeBlock { 0..11; }

# group: SELECT WALL CENTERLINES
categories = Categories("Walls")
all_elements_of_category = ElementsOfCategory(categories)
location = Custom[Element.Location](element=all_elements_of_category)  # Returns the location of an element as an XYZ (or if it's line-based the start and end point of the line), along with some booleans to help filtering the results. Use this for some element types (e.g. walls or lines) that do not work with the built-in Get Family Instance Location node.
DS_CurvesToRhino = Interoperability.WriteRhino.CreateRhinoGeometry.DS_CurvesToRhino(location.curves)
string_from_object = FromObject(code_block)
code_block_2 = CodeBlock { 255; 0; }
create_RhinoColor = Interoperability.WriteRhino.CreateRhinoObjects.Create_RhinoColor(code_block_2.out0, code_block_2.out1, code_block_2.out1)
code_block_3 = CodeBlock { "Walls"; }
create_RhinoLayer = Interoperability.WriteRhino.CreateRhinoObjects.Create_RhinoLayer(code_block_3, create_RhinoColor)
create_RhinoObject = Interoperability.WriteRhino.CreateRhinoObjects.Create_RhinoObject(DS_CurvesToRhino, string_from_object, create_RhinoColor, create_RhinoLayer)
id = Element.Id(all_elements_of_category)

# group: SELECT ANALYTICAL WALL SURFACES
categories_2 = Categories("WallAnalytical")
all_elements_of_category_2 = ElementsOfCategory(categories_2)
geometry = Element.Geometry(all_elements_of_category_2)
code_block_4 = CodeBlock { 0; }
getItemAtIndex = List.GetItemAtIndex(list=geometry, index=code_block_4, lacing=Longest)
id_2 = Element.Id(all_elements_of_category_2)
string_from_object_2 = FromObject(id_2)
code_block_5 = CodeBlock { 255; 0; }
create_RhinoColor_2 = Interoperability.WriteRhino.CreateRhinoObjects.Create_RhinoColor(code_block_5.out1, code_block_5.out0, code_block_5.out1)
code_block_6 = CodeBlock { "WallSurfaces"; }
create_RhinoLayer_2 = Interoperability.WriteRhino.CreateRhinoObjects.Create_RhinoLayer(code_block_6, create_RhinoColor_2)

toNurbsSurface = Surface.ToNurbsSurface(getItemAtIndex)

# group (continued): SELECT ANALYTICAL WALL SURFACES
DS_NurbsSurfaceToRhino = Interoperability.WriteRhino.CreateRhinoGeometry.DS_NurbsSurfaceToRhino(toNurbsSurface)
create_RhinoObject_2 = Interoperability.WriteRhino.CreateRhinoObjects.Create_RhinoObject(DS_NurbsSurfaceToRhino, string_from_object_2, create_RhinoColor_2, create_RhinoLayer_2)

code_block_7 = CodeBlock(a=create_RhinoObject, b=create_RhinoObject_2) { Flatten({a,b}); }
code_block_8 = CodeBlock { "millimeters"; }
save_Rhino3dmModel = Interoperability.WriteRhino.SaveRhino3dmModel.Save_Rhino3dmModel(file_path, boolean, code_block_7, code_block_8)
deconstruct = List.Deconstruct(list=geometry, lacing=Longest)
code_block_9 = CodeBlock(s=deconstruct.rest) { s[7]; }
group_curves = Custom[Group Curves](Curves=deconstruct.rest, lacing=Longest)  # This node will take any input of flat list of curves and group them into sublists containing "joinable" curves that is continous curves. They might form closed curves or open curves. Use PolyCurve.ByJoinedCurves to convert output groups of curves into single PolyCurves
deconstruct_2 = List.Deconstruct(list=group_curves@L3)
code_block_10 = CodeBlock(a=deconstruct_2.rest) { a; }
code_block_11 = CodeBlock { 0; }
clean = List.Clean(list=code_block_10, preserveIndices=code_block_11)
code_block_12 = CodeBlock(a=all_elements_of_category_2) { a[7]; }
code_block_13 = CodeBlock(a=getItemAtIndex) { a[0]; }
file_path_2 = Filename("..\Desktop\19.geo")
code_block_14 = CodeBlock { 1; }
write_gh_file = Custom[Write GH File](Geometry=code_block_13, File_Path=file_path_2, Export=code_block_14)  # This node exports Dynamo (Design Script) geometry/data to Grasshopper.
byJoinedCurves = PolyCurve.ByJoinedCurves(group_curves)
byPatch = Surface.ByPatch(byJoinedCurves)
code_block_15 = CodeBlock(a=byPatch) { a[11]; }
