# Dynamo graph windows05.dyn (Dynamo 1.3.1.1736)

get_linked_rvt_documents = Custom[Get Linked RVT Documents]()
categories = Categories("Windows")
linkedInstanceElements = Custom[Springs.Collector.LinkedInstanceElements](LinkInstance=get_linked_rvt_documents.Link_Instance, category=categories)  # Extract elements by category from the selected linked instances. The transform vector can be used to get the exact location of the elements in the local file
name = Element.Name()  # unwired: arg0
groupByFunction = GroupByFunction(linkedInstanceElements.elements, name)
code_block = CodeBlock(a=groupByFunction) { a[0]; }
boundingBox = Geometry.BoundingBox(code_block)
select_model_element = DSModelElementSelection()
family_types = FamilyTypes("Window_void:void")
boundingBox_2 = Geometry.BoundingBox(select_model_element)
code_block_2 = CodeBlock { 0; }
getElementsIntersect = Revit.BoundingBox.GetElementsIntersect(boundingBox_2, linkedInstanceElements.elements, code_block_2)
location = Custom[Element.Location](element=getElementsIntersect)  # Returns the location of an element as an XYZ (or if it's line-based the start and end point of the line), along with some booleans to help filtering the results. Use this for some element types (e.g. walls or lines) that do not work with the built-in Get Family Instance Location node.
byPoints = Custom[Springs.HostedInstance.ByPoints](host=select_model_element, type=family_types, point=location.points)  # Creates hosted family instances(doors/windows) at the specified points. You can feed either a single family type or a unique type for each instance.
code_block_3 = CodeBlock { "Void_Width"; }
getType = FamilyInstance.GetType(getElementsIntersect)
code_block_4 = CodeBlock { {"Width","Height"}; }
getParameterValueByName = Element.GetParameterValueByName(element=getType, parameterName=code_block_4, lacing=CrossProduct)
code_block_5 = CodeBlock { 0; }
round = Math.Round(number=getParameterValueByName, digits=code_block_5)
code_block_6 = CodeBlock { 0; }
getItemAtIndex = List.GetItemAtIndex(list=round, index=code_block_6, lacing=Longest)
setParameterByName = Element.SetParameterByName(element=byPoints, parameterName=code_block_3, value=getItemAtIndex, lacing=Longest)
code_block_7 = CodeBlock { "Void_height"; }
code_block_8 = CodeBlock { 1; }
getItemAtIndex_2 = List.GetItemAtIndex(list=round, index=code_block_8, lacing=Longest)
setParameterByName_2 = Element.SetParameterByName(element=byPoints, parameterName=code_block_7, value=getItemAtIndex_2, lacing=Longest)
