# Dynamo graph WallsColouring.dyn (Dynamo 1.3.0.875)

select_model_elements = DSModelElementsSelection()  # 1 picked in the model
faces = Element.Faces(select_model_elements)
area = Surface.Area(faces)
maximumItem = List.MaximumItem(area)
eq = area == maximumItem
filterByBoolMask = List.FilterByBoolMask(list=faces, mask=eq)
perimeterCurves = Surface.PerimeterCurves(filterByBoolMask.in)
length = Curve.Length(perimeterCurves)
maximumItem_2 = List.MaximumItem(length)
uniqueItems = List.UniqueItems(maximumItem_2)
allIndicesOf = List.AllIndicesOf(list=length, item=uniqueItems, lacing=Longest)
getItemAtIndex = List.GetItemAtIndex(list=perimeterCurves, index=allIndicesOf, lacing=Longest)
get_revit_activeview = Custom[Get Revit ActiveView]()  # Active View
code_block = CodeBlock { 0..1..#10; }
code_block_2 = CodeBlock { {0..0.125..#10}; {0..0.825..#10}; }
pointAtParameter = Surface.PointAtParameter(surface=filterByBoolMask.in, u=code_block, v=code_block_2.out0, lacing=CrossProduct)
flatten = Flatten(pointAtParameter)
code_block_3 = CodeBlock { 1; }
count = List.Count(flatten)
cycle = List.Cycle(list=code_block_3, amount=count)
code_block_4 = CodeBlock { "red"; "Red Description"; null; }
byViewPointsAndValues = Revit.AnalysisDisplay.PointAnalysisDisplay.ByViewPointsAndValues(get_revit_activeview, flatten, cycle, code_block_4.out0, code_block_4.out1, code_block_4.out2)
byViewFacePointsAndValues = Revit.AnalysisDisplay.FaceAnalysisDisplay.ByViewFacePointsAndValues(arg1=filterByBoolMask.in@L1, arg2=flatten, arg3=cycle, arg4=code_block_4.out0, arg5=code_block_4.out1, arg6=code_block_4.out2, lacing=Longest)  # unwired: arg0
