# Dynamo graph WallsColouring02.dyn (Dynamo 1.3.0.875)

select_model_elements = DSModelElementsSelection()  # 1 picked in the model
faces = Element.Faces(select_model_elements)
area = Surface.Area(faces)
maximumItem = List.MaximumItem(area)
eq = area == maximumItem
filterByBoolMask = List.FilterByBoolMask(list=faces, mask=eq)
perimeterCurves = Surface.PerimeterCurves(filterByBoolMask.in)
length = Curve.Length(perimeterCurves)
maximumItem_2 = List.MaximumItem(length)
uniqueItems = List.UniqueItems(maximumItem_2)
allIndicesOf = List.AllIndicesOf(list=length, item=uniqueItems, lacing=Longest)
getItemAtIndex = List.GetItemAtIndex(list=perimeterCurves, index=allIndicesOf, lacing=Longest)
get_revit_activeview = Custom[Get Revit ActiveView]()  # Active View
code_block = CodeBlock { 10; }
code_block_2 = CodeBlock(b=code_block) { 0..1..#b; }
code_block_3 = CodeBlock { 10; }
code_block_4 = CodeBlock(a=code_block_3)
# ---------- code_block_4.designscript (2 lines) ----------
{0..0.125..#a,
0.875..1..#a,0.125..0.250..#a,0.750..0.875..#a};
# ----------------------------------------
pointAtParameter = Surface.PointAtParameter(surface=filterByBoolMask.in, u=code_block_2, v=code_block_4, lacing=CrossProduct)
flatten = Flatten(pointAtParameter)
code_block_5 = CodeBlock { {1,2,1,2}; }
code_block_6 = CodeBlock(a=code_block_3, b=code_block) { a*b*2; }
cycle = List.Cycle(list=code_block_5@L1, amount=code_block_6)
flatten_2 = Flatten(cycle)
code_block_7 = CodeBlock { "Penetration Zones"; "Orange TBC, Red No"; null; }
byViewPointsAndValues = Revit.AnalysisDisplay.PointAnalysisDisplay.ByViewPointsAndValues(get_revit_activeview, flatten, flatten_2, code_block_7.out0, code_block_7.out1, code_block_7.out2)
