# Dynamo graph adaptiveComponentsByPts.dyn (Dynamo 2.2.1.5175)

select_model_element = DSModelElementSelection()  # 1 picked in the model
select_model_elements = DSModelElementsSelection()  # 3 picked in the model
python_script = Python(IN[0]=select_model_elements)
# ---------- python_script.python (55 lines) ----------
import clr

clr.AddReference('RevitAPI')
from Autodesk.Revit.DB import *
from Autodesk.Revit.DB.Structure import *

clr.AddReference('RevitAPIUI')
from Autodesk.Revit.UI import *

clr.AddReference('System')
from System.Collections.Generic import List

clr.AddReference('RevitNodes')
import Revit
clr.ImportExtensions(Revit.GeometryConversion)
clr.ImportExtensions(Revit.Elements)

clr.AddReference('RevitServices')
import RevitServices
from RevitServices.Persistence import DocumentManager
from RevitServices.Transactions import TransactionManager

doc = DocumentManager.Instance.CurrentDBDocument
uidoc=DocumentManager.Instance.CurrentUIApplication.ActiveUIDocument

#Preparing input from dynamo to revit
beams = UnwrapElement(IN[0])


def BeamEndPoints_InstaGeom(beam):
	opt = Options()
	opt.ComputeReferences = True
	opt.IncludeNonVisibleObjects = True
	#opt.View = doc.ActiveView
	opt.DetailLevel = ViewDetailLevel.Medium
	
	geo = beam.get_Geometry(opt)
	solids = []
	
	for item in geo:
		try:
			solids.append(item.GetInstanceGeometry())
		except:
			""
	faces = [solid.Faces for solid in solids[0] if solid.Volume>0.1]
	bb1 = faces[0][0].Origin
	bb2 = faces[0][1].Origin
	return [[bb1.ToPoint(), bb2.ToPoint()]]

points = []


OUT = [BeamEndPoints_InstaGeom(b) for b in beams]

#OUT = faces
# ----------------------------------------
family_types = FamilyTypes("Shear Studs Repeating:Shear Studs Repeating")
byPoints = AdaptiveComponent.ByPoints(points=python_script, familyType=family_types)
byParametersOnCurveReference = AdaptiveComponent.ByParametersOnCurveReference()  # unwired: parameters, curve, familyType
select_model_elements_2 = DSModelElementsSelection()  # 1 picked in the model
code_block = CodeBlock(a=python_script) { a[0][0]; a[0][1]; }
byStartPointEndPoint = Line.ByStartPointEndPoint(startPoint=code_block.out0, endPoint=code_block.out1)
byCurve = ModelCurve.ByCurve(curve=byStartPointEndPoint)
