# Dynamo graph adaptiveComponentsByPts2.dyn (Dynamo 2.2.1.5175)

select_model_elements = DSModelElementsSelection()  # 3 picked in the model
location = StructuralFraming.Location(structuralFraming=select_model_elements)
code_block = CodeBlock { ["z Offset Value"]; }
getParameterValueByName = Element.GetParameterValueByName(element=select_model_elements, parameterName=code_block, lacing=CrossProduct)
code_block_2 = CodeBlock { "COBie.Type.NominalHeight"; }
getParameterValueByName_2 = Element.GetParameterValueByName(element=select_model_elements, parameterName=code_block_2, lacing=CrossProduct)
ceiling = Math.Ceiling(number=getParameterValueByName_2)
code_block_3 = CodeBlock(offset=getParameterValueByName, depth=ceiling) { offset - depth/2; }
translate = Geometry.Translate(geometry=location, zTranslation=code_block_3)
code_block_4 = CodeBlock { [0,1]; }
pointAtParameter = Curve.PointAtParameter(curve=translate, param=code_block_4, lacing=CrossProduct)
flatten = List.Flatten(list=pointAtParameter, lacing=Longest)
family_types = FamilyTypes("Shear Studs Repeating:Shear Studs Repeating")
byPoints = AdaptiveComponent.ByPoints(points=flatten, familyType=family_types)
code_block_5 = CodeBlock { "Web Thickness"; }
type = archilab.Revit.Elements.Elements.Type(element=select_model_elements)
code_block_6 = CodeBlock { "tw"; }
getParameterValueByName_3 = Element.GetParameterValueByName(element=type, parameterName=code_block_6, lacing=CrossProduct)
setParameterByName = Element.SetParameterByName(element=byPoints, parameterName=code_block_5, value=getParameterValueByName_3)
code_block_7 = CodeBlock { "Offset_Start"; }
code_block_8 = CodeBlock { 500; }
setParameterByName_2 = Element.SetParameterByName(element=setParameterByName, parameterName=code_block_7, value=code_block_8)
