# Dynamo graph addCoping.dyn (Dynamo 0.8.2.2392)

select_model_elements = DSModelElementsSelection()  # 5 picked in the model
select_model_elements_2 = DSModelElementsSelection()  # 2 picked in the model
addCoping = Custom[FamilyInstance.AddCoping](familyInstance=select_model_elements, cuttingElement=select_model_elements_2, lacing=Longest)  # Adds a coping (cut) to a steel beam
python_script = Python()
# ---------- python_script.python (27 lines) ----------
import clr
import System
clr.AddReference('RevitAPI')
from Autodesk.Revit.DB import *

clr.AddReference("RevitServices")
import RevitServices
from RevitServices.Persistence import DocumentManager
from RevitServices.Transactions import TransactionManager

doc = DocumentManager.Instance.CurrentDBDocument
fams = UnwrapElement(IN[0])
cutters = UnwrapElement(IN[1])
booleans = list()
counter = 0

TransactionManager.Instance.EnsureInTransaction(doc)
for fam in fams:
	try:
		fam.AddCoping(cutters[0])
		fam.AddCoping(cutters[1])
		booleans.append(True)
	except:	booleans.append(False)
	
TransactionManager.Instance.TransactionTaskDone()

OUT = booleans
# ----------------------------------------
