# Dynamo graph addScheduleFilter01.dyn (Dynamo 1.3.2.2480)

views = Views("Structural Column Schedule L13")
code_block = CodeBlock { 1..13; }
string_from_object = FromObject(code_block)
code_block_2 = CodeBlock(a=string_from_object) { "Structural Framing Schedule GA - LEVEL " + a; }
code_block_3 = CodeBlock { "Duplicate"; }
duplicate = archilab.Revit.Views.Views.Duplicate(views, code_block_2, code_block_3)
clearAllFilters = ScheduleView.ClearAllFilters(duplicate)
fields = ScheduleView.Fields(views)
code_block_4 = CodeBlock(a=fields) { a[2]; }
schedule_filter_type = ScheduleFilterType("Equal")
code_block_5 = CodeBlock(a=string_from_object) { "LEVEL " + a; }
byName = WombatDynamo.Level.ByName(code_block_5)
byFieldTypeAndValue = Revit.Schedules.ScheduleFilter.ByFieldTypeAndValue(field=code_block_4, filterType=schedule_filter_type, value=byName)
addFilters = ScheduleView.AddFilters(scheduleView=clearAllFilters@L1, scheduleFilters=byFieldTypeAndValue@L1)
python_script = Python()  # unwired: IN[0], IN[1], IN[2]
# ---------- python_script.python (50 lines) ----------
import clr
clr.AddReference('ProtoGeometry')
from Autodesk.DesignScript.Geometry import *


# Import DocumentManager and TransactionManager
clr.AddReference("RevitServices")
import RevitServices
from RevitServices.Persistence import DocumentManager
from RevitServices.Transactions import TransactionManager


# Import RevitAPI
clr.AddReference("RevitAPI")
import Autodesk
from Autodesk.Revit.DB import *


doc = DocumentManager.Instance.CurrentDBDocument
uiapp = DocumentManager.Instance.CurrentUIApplication
app = uiapp.Application


from System.Collections.Generic import *


# Import ToDSType(bool) extension method
clr.AddReference("RevitNodes")
import Revit
clr.ImportExtensions(Revit.Elements)

refschedule = UnwrapElement(IN[0])
tgtschedules = UnwrapElement(IN[1])
tgtstrings = IN[2]

refdefinition = refschedule.Definition
reffilter = refdefinition.GetFilter(0)

TransactionManager.Instance.EnsureInTransaction(doc)

for tgtstring in tgtstrings
	tgtfilter = reffilter.SetValue(tgtstring)

for tgtschedule in tgtschedules:
	tgtdefinition = tgtschedule.Definition
	tgtdefinition.InsertFilter(reffilter, 0)

TransactionManager.Instance.TransactionTaskDone()

OUT = tgtschedules;
# ----------------------------------------
