# Dynamo graph addViewsToSheet.dyn (Dynamo 1.3.2.2480)

# group: Select the sheet
sheets = Sheets("zBS-001 : Unnamed")

# group: Select the views to place on a sheet
categories = Categories("Views")
all_elements_of_category = ElementsOfCategory(categories)
name = Element.Name(all_elements_of_category)
# note: from Lunchbox
removeNulls = Lists.Manage.RemoveNulls(name)
removeItemAtIndex = List.RemoveItemAtIndex(list=all_elements_of_category, indices=removeNulls.out1)
code_block = CodeBlock { "PC"; }
contains = String.Contains(str=removeNulls.out0, searchFor=code_block)
filterByBoolMask = List.FilterByBoolMask(list=removeItemAtIndex, mask=contains)

select_model_element = DSModelElementSelection()  # 1 picked in the model
curves = Element.Curves(select_model_element)
code_block_2 = CodeBlock { 4; }
code_block_3 = CodeBlock(division=code_block_2) { 0..1..#division; }
pointAtParameter = Curve.PointAtParameter(curve=curves, param=code_block_3, lacing=Longest)
# note: from Rhythm
create = Rhythm.Revit.Elements.Viewport.Create(sheets, filterByBoolMask.in, pointAtParameter)

# group: Set the views position
count = List.Count(filterByBoolMask.in)
code_block_4 = CodeBlock(columns=count) { 150..500..#columns; }
code_block_5 = CodeBlock { 1; }
code_block_6 = CodeBlock(rows=code_block_5) { 564/(rows+1); }

byCoordinates = Point.ByCoordinates(x=code_block_4, y=code_block_6)
