# Dynamo graph areaBoundary.dyn (Dynamo 1.3.1.1736)

select_model_elements = DSModelElementsSelection()  # 8 picked in the model
type = Object.Type(select_model_elements)
categories = Categories("Areas")
all_elements_of_category = ElementsOfCategory(categories)
code_block = CodeBlock(a=all_elements_of_category) { a[2]; }
levels = Levels("00")

# group: RHYTHM
areas = Custom[Collector.Areas](Level=levels)  # This is an area collector element that utilizes mostly OOTB nodes.

code_block_2 = CodeBlock(a=areas.areaElements) { {a}; }
python_script = Python(IN[0]=code_block_2)
# ---------- python_script.python (52 lines) ----------
import clr
clr.AddReference('RevitAPI')
from Autodesk.Revit.DB import *
import Autodesk

clr.AddReference("RevitNodes")
import Revit
clr.ImportExtensions(Revit.GeometryConversion)

clr.AddReference("RevitServices")
import RevitServices
from RevitServices.Persistence import DocumentManager

uiapp = DocumentManager.Instance.CurrentUIApplication
app = uiapp.Application
items = UnwrapElement(IN[0])
version = app.VersionNumber
elementlist = list()
curvelist = list()

for item in items:
	doc = item.Document
	calculator = SpatialElementGeometryCalculator(doc)
	options = Autodesk.Revit.DB.SpatialElementBoundaryOptions()
	# get boundary location from area computation settings
	boundloc = Autodesk.Revit.DB.AreaVolumeSettings.GetAreaVolumeSettings(doc).GetSpatialElementBoundaryLocation(SpatialElementType.Room)
	options.SpatialElementBoundaryLocation = boundloc
	#method #1 - get boundary segments
	blist = list()
	clist = list()
	try:
		for boundarylist in item.GetBoundarySegments(options):
			for boundary in boundarylist:
				blist.append(doc.GetElement(boundary.ElementId))
				if version > 2016:
					clist.append(boundary.GetCurve().ToProtoType())
				else:
					clist.append(boundary.Curve.ToProtoType())
	except:
		pass
	#method #2 - spatial element geometry calculator
	try:
		results = calculator.CalculateSpatialElementGeometry(item)
		for face in results.GetGeometry().Faces:
			for bface in results.GetBoundaryFaceInfo(face):
				blist.append(doc.GetElement(bface.SpatialBoundaryElement.HostElementId))
	except:
		pass	
	# write results to list
	elementlist.append(blist)
	curvelist.append(clist)
OUT = (elementlist,curvelist)
# ----------------------------------------
code_block_3 = CodeBlock { 1; }
lunchbox_area_element_collector = Custom[LunchBox Area Element Collector](Toggle=code_block_3)  # Collects rooms from the Revit document
