# Dynamo graph AnalyticalLoads.dyn (Dynamo 1.3.1.1736)

select_model_element = DSModelElementSelection()  # 1 picked in the model
geometry = Element.Geometry(select_model_element)
deconstruct = List.Deconstruct(list=geometry)
