# Dynamo graph AutomaticPlaceAreas.dyn (Dynamo 1.3.1.1736)

group_curves = Custom[Group Curves](lacing=Longest)  # This node will take any input of flat list of curves and group them into sublists containing "joinable" curves that is continous curves. They might form closed curves or open curves. Use PolyCurve.ByJoinedCurves to convert output groups of curves into single PolyCurves; unwired: Curves
get_revit_activeview = Custom[Get Revit ActiveView]()  # Active View
select_model_elements = DSModelElementsSelection()
curves = Element.Curves(select_model_elements)
flatten = Flatten(curves)
code_block = CodeBlock { 4; }
chop = List.Chop(list=flatten, lengths=code_block)
endPoint = Curve.EndPoint(chop)
byPoints = Polygon.ByPoints(endPoint, lacing=Longest)
center = Polygon.Center(byPoints)
removeNulls = Lists.Manage.RemoveNulls(center)
python_script = Python(IN[0]=get_revit_activeview, IN[1]=removeNulls)
# ---------- python_script.python (43 lines) ----------
import clr
clr.AddReference('ProtoGeometry')
from Autodesk.DesignScript.Geometry import *
#Import ToDSType(bool) extension method
clr.AddReference('RevitNodes')
import Revit
clr.ImportExtensions(Revit.GeometryConversion)
#Import DocumentManager and TransactionManager
clr.AddReference('RevitServices')
import RevitServices
from RevitServices.Persistence import DocumentManager
from RevitServices.Transactions import TransactionManager
from System.Collections.Generic import *
#import RevitAPI
clr.AddReference('RevitAPI')
import Autodesk
from Autodesk.Revit.DB import *
from Autodesk.Revit.DB.Structure import *
from System.Collections.Generic import *


doc = DocumentManager.Instance.CurrentDBDocument
uiapp = DocumentManager.Instance.CurrentUIApplication
app = uiapp.Application


view = UnwrapElement(IN[0])

points = UnwrapElement(IN[1])

TransactionManager.Instance.EnsureInTransaction(doc)

areas = []

for p in points:
	q = UV(p.X, p.Y)
	a = doc.Create.NewArea(view,q)
	areas.append(a)
	
TransactionManager.Instance.TransactionTaskDone()

#Assign your outputs to the OUT variable
OUT = areas
# ----------------------------------------
python_script_2 = Python(IN[0]=center)
# ---------- python_script_2.python (39 lines) ----------
import clr
clr.AddReference('ProtoGeometry')
from Autodesk.DesignScript.Geometry import *
#Import ToDSType(bool) extension method
clr.AddReference('RevitNodes')
import Revit
clr.ImportExtensions(Revit.GeometryConversion)
#Import DocumentManager and TransactionManager
clr.AddReference('RevitServices')
import RevitServices
from RevitServices.Persistence import DocumentManager
from RevitServices.Transactions import TransactionManager
from System.Collections.Generic import *
#import RevitAPI
clr.AddReference('RevitAPI')
import Autodesk
from Autodesk.Revit.DB import *
from Autodesk.Revit.DB.Structure import *
from System.Collections.Generic import *


doc = DocumentManager.Instance.CurrentDBDocument
uiapp = DocumentManager.Instance.CurrentUIApplication
app = uiapp.Application


points = UnwrapElement(IN[0])



areas = []

for p in points:
	areas.append(p.X)
	


#Assign your outputs to the OUT variable
OUT = areas
# ----------------------------------------
select_model_element = DSModelElementSelection()
parameters = Element.Parameters(select_model_element)
name = Element.Name(parameters)
code_block_2 = CodeBlock { 1; }
python_script_3 = Python(IN[0]=select_model_element, IN[1]=name, IN[2]=code_block_2)
# ---------- python_script_3.python (53 lines) ----------
import clr
clr.AddReference('ProtoGeometry')
from Autodesk.DesignScript.Geometry import *
clr.AddReference('RevitAPI')
from Autodesk.Revit.DB import *

clr.AddReference("RevitServices")
import RevitServices
from RevitServices.Persistence import DocumentManager
from RevitServices.Transactions import TransactionManager
doc = DocumentManager.Instance.CurrentDBDocument
#The inputs to this node will be stored as a list in the IN variables.

element = UnwrapElement(IN[0])
name = IN[1]
values = IN[2]

parameters = []
listout = []
newValues = []
PU = []
Display = []
US = UnitUtils.GetValidDisplayUnits()
removed = []

def checkParameter(param):
	for p in param:
		internal = p.Definition
		if internal.BuiltInParameter != BuiltInParameter.INVALID:
			return p
	return param[0]

for n in name:
	param = element.GetParameters(n)
	if len(param) == 0:
		parameters.append(None)
	else:
		p = checkParameter(param)
		parameters.append(p)
		listout.append(p.StorageType)
		listout.append(p.Definition)

for p in parameters:
	try:
		ProjectUnits = p.DisplayUnitType
		Names = str(p.Definition.Name) + "[" + str(p.StorageType) + "]"
		Display.append(Names)
		PU.append(ProjectUnits)
		newValues.append(UnitUtils.ConvertToInternalUnits(values,ProjectUnits))
	except:
		removed.append(p.Definition.Name)
#Assign your output to the OUT variable.
OUT = Display, PU, newValues, US, removed
# ----------------------------------------
code_block_3 = CodeBlock(a=python_script_3) { a[1]; }
code_block_4 = CodeBlock(a=code_block_3) { a[0]; }
toDisplayUnit = Custom[InternalUnit.ToDisplayUnit](val=python_script_2, displayUnitType=code_block_4)  # Converts a value from Revit's internal unit to a given display unit
python_script_4 = Python()  # unwired: IN[0], IN[1]
# ---------- python_script_4.python (10 lines) ----------
import clr
clr.AddReference('RevitAPI')
from Autodesk.Revit.DB import *

vals = IN[0]
dispunit = IN[1]
elementlist = []
for val in vals:
	elementlist.append(UnitUtils.ConvertFromInternalUnits(val,dispunit))
OUT = elementlist
# ----------------------------------------
unitType = Parameter.UnitType(parameters)
code_block_5 = CodeBlock(a=python_script_3) { a[0]; }
code_block_6 = CodeBlock(a=python_script_3) { a[4]; }
code_block_7 = CodeBlock(a=python_script_3) { a[2]; }
code_block_8 = CodeBlock { {300}; }
convertToInternalUnits = Python(IN[0]=code_block_8, IN[1]=code_block_4)
# ---------- convertToInternalUnits.python (26 lines) ----------
import clr
clr.AddReference('ProtoGeometry')
from Autodesk.DesignScript.Geometry import *
clr.AddReference('RevitAPI')
from Autodesk.Revit.DB import *

clr.AddReference("RevitServices")
import RevitServices
from RevitServices.Persistence import DocumentManager
from RevitServices.Transactions import TransactionManager
doc = DocumentManager.Instance.CurrentDBDocument
#The inputs to this node will be stored as a list in the IN variables.

values = IN[0]
PU = IN[1]

listout = []
newValues = []


for v in values:
	ProjectUnits = DisplayUnitType.DUT_LITERS_PER_SECOND
	newValues.append(UnitUtils.ConvertToInternalUnits(v,PU))
	
#Assign your output to the OUT variable.
OUT = newValues
# ----------------------------------------
python_script_5 = Python(IN[0]=center)
# ---------- python_script_5.python (40 lines) ----------
import clr
clr.AddReference('ProtoGeometry')
from Autodesk.DesignScript.Geometry import *
#Import ToDSType(bool) extension method
clr.AddReference('RevitNodes')
import Revit
clr.ImportExtensions(Revit.GeometryConversion)
#Import DocumentManager and TransactionManager
clr.AddReference('RevitServices')
import RevitServices
from RevitServices.Persistence import DocumentManager
from RevitServices.Transactions import TransactionManager
from System.Collections.Generic import *
#import RevitAPI
clr.AddReference('RevitAPI')
import Autodesk
from Autodesk.Revit.DB import *
from Autodesk.Revit.DB.Structure import *
from System.Collections.Generic import *


doc = DocumentManager.Instance.CurrentDBDocument
uiapp = DocumentManager.Instance.CurrentUIApplication
app = uiapp.Application


points = UnwrapElement(IN[0])

ProjectUnits = DisplayUnitType.DUT_MILLIMETERS

areas = []

for p in points:
	newX = UnitUtils.ConvertToInternalUnits(p.X,ProjectUnits)
	newY = UnitUtils.ConvertToInternalUnits(p.Y,ProjectUnits)
	areas.append(Autodesk.DesignScript.Geometry.Point.ByCoordinates(newX,newY,0))
	

#Assign your outputs to the OUT variable
OUT = areas
# ----------------------------------------
python_script_6 = Python()  # unwired: IN[0]
# ---------- python_script_6.python (11 lines) ----------
import clr
clr.AddReference('ProtoGeometry')
from Autodesk.DesignScript.Geometry import*
#The inputs to this node will be stored as a list in the IN variables.
dataEnteringNode = IN




#Assign your output to the OUT variable.
OUT = Point.ByCoordinates(0,0,0)
# ----------------------------------------
