# Dynamo graph Create_Area_Loads_Boundary.dyn (Dynamo 1.3.1.1736)

boolean = BoolSelector(true)

# group: LunchBox AreaElement Collector
python_script = Python(IN[0]=boolean)
# ---------- python_script.python (110 lines) ----------
#Copyright(c) 2014, Nathan Miller
# The Proving Ground, http://theprovingground.org

import clr

# Import RevitAPI
clr.AddReference("RevitAPI")
import Autodesk
from Autodesk.Revit.DB import *

# Import DocumentManager and TransactionManager
clr.AddReference("RevitServices")
import RevitServices
from RevitServices.Persistence import DocumentManager
from RevitServices.Transactions import TransactionManager

# Import ToDSType(bool) extension method
clr.AddReference("RevitNodes")
import Revit
clr.ImportExtensions(Revit.Elements)
clr.ImportExtensions(Revit.GeometryConversion)

import clr
clr.AddReference('ProtoGeometry')
from Autodesk.DesignScript.Geometry import *

#The input to this node will be stored in the IN[0] variable.

doc =  DocumentManager.Instance.CurrentDBDocument
app =  DocumentManager.Instance.CurrentUIApplication.Application

toggle = IN[0]

output = []
rooms = []
names = []
numbers = []
areas = []
levels = []
boundaries = []
locations = []
areaschemes = []
elementids = []
uniqueids = []

if toggle == True:

	collector = FilteredElementCollector(doc)
	collector.OfCategory(BuiltInCategory.OST_Areas)
 
	famtypeitr = collector.GetElementIdIterator()
	famtypeitr.Reset()


	for item in famtypeitr:
		famtypeID = item
		faminst = doc.GetElement(famtypeID)
    
		#print faminst
		if faminst.Area > 0:
			room = faminst
			for p in room.Parameters:
				if p.Definition.Name == 'Name':		
					roomname = p.AsString()
				if p.Definition.Name == 'Level':			
					level = p.AsValueString()
					if (level is None):
						level = p.AsString()

			number = faminst.Number
			area = faminst.Area
			location = faminst.Location.Point.ToPoint()
			areascheme = faminst.AreaScheme.Name
			elementid = faminst.Id.ToString()
			uniqueid = faminst.UniqueId
    	
			boptions = Autodesk.Revit.DB.SpatialElementBoundaryOptions()
			boundsegs = room.GetBoundarySegments(boptions)
			boundcurves = []
			for bound in boundsegs:
				crvs = []
				for seg in bound:
					crv = seg.GetCurve()
					crvs.append(Revit.GeometryConversion.RevitToProtoCurve.ToProtoType( crv, True ))
				boundcurves.append(crvs)
    	
			rooms.append(room)
			names.append(roomname)
			numbers.append(number)
			areas.append(area)
			levels.append(level)
			boundaries.append(boundcurves)
			areaschemes.append(areascheme)
			locations.append(location)
			elementids.append(elementid)
			uniqueids.append(uniqueid)
        
	output.append(rooms)
	output.append(names)
	output.append(numbers)
	output.append(areas)
	output.append(levels)
	output.append(locations)
	output.append(boundaries)
	output.append(areaschemes)
	output.append(elementids)
	output.append(uniqueids)
        
#Assign your output to the OUT variable
OUT = output
# ----------------------------------------

code_block = CodeBlock(Out_Boundaries=python_script) { Out_Boundaries[6]; }

# group: GET THE BOUNDARY LINES END POINTS AND COPY THE FIRST POINT TO THE END OF THE LIST. (NEEDED FOR THE CREATE BOUND METHOD)
endPoint = Curve.EndPoint(code_block)
python_script_2 = Python(IN[0]=endPoint)
# ---------- python_script_2.python (30 lines) ----------
import clr

clr.AddReference('RevitAPI')
from Autodesk.Revit.DB import *

clr.AddReference("RevitNodes")
import Revit
# Import ToProtoType, ToRevitType geometry conversion extension methods
clr.ImportExtensions(Revit.GeometryConversion)


pts = IN[0]
elementlist = []

for pt in pts:
	for i in range(0,len(pt)):
		subList = []
		elementlist.append(subList)
		for j in range(0,len(pt[i])):
			subList.append(pt[i][j].ToRevitType())
		subList.append(pt[i][0].ToRevitType())
			

newList = []

for el in elementlist:
	newList.append([el])


OUT = newList
# ----------------------------------------

python_script_3 = Python(IN[0]=python_script_2)  # unwired: IN[1], IN[2]
# ---------- python_script_3.python (75 lines) ----------
import clr
clr.AddReference('ProtoGeometry')
from Autodesk.DesignScript.Geometry import *
#Import ToDSType(bool) extension method
clr.AddReference('RevitNodes')
import Revit
clr.ImportExtensions(Revit.GeometryConversion)
#Import DocumentManager and TransactionManager
clr.AddReference('RevitServices')
import RevitServices
from RevitServices.Persistence import DocumentManager
from RevitServices.Transactions import TransactionManager
from System.Collections.Generic import *
#import RevitAPI
clr.AddReference('RevitAPI')
import Autodesk
from Autodesk.Revit.DB import *
from Autodesk.Revit.DB.Structure import *
from System.Collections.Generic import *


doc = DocumentManager.Instance.CurrentDBDocument
uiapp = DocumentManager.Instance.CurrentUIApplication
app = uiapp.Application


lista = IN[0]

profileLoops = []


for l in lista:
	if len(l)>1:
		oP = l[0]
		iP = l[1:]
		outerProfileLoop = CurveLoop()
		ip = []
		loops = [outerProfileLoop]
		profileLoops.Add(loops)	
		for i in range(0,len(oP)-1):
			outerProfileLoop.Append(Autodesk.Revit.DB.Line.CreateBound(oP[i],oP[i+1]))
		for j in range(0,len(iP)):
			innerProfileLoop = CurveLoop()
			loops.append(innerProfileLoop)
			for i in range(0,len(iP[j])-1):
				innerProfileLoop.Append(Autodesk.Revit.DB.Line.CreateBound(iP[j][i],iP[j][i+1]))					
	else:
		oP = l[0]
		outerProfileLoop = CurveLoop()
		profileLoops.Add([outerProfileLoop])
		for i in range(0,len(oP)-1):
			outerProfileLoop.Append(Autodesk.Revit.DB.Line.CreateBound(oP[i],oP[i+1]))
	

F=IN[1]

loadtype=UnwrapElement(IN[2])

TransactionManager.Instance.EnsureInTransaction(doc)

loads=[]


for j in range(0,len(loadtype)):
	listLoad = []
	loads.append(listLoad)
	for i in range(0,len(profileLoops)):
		listLoad.append(AreaLoad.Create(doc,profileLoops[i],F[j][i].ToXyz(False),loadtype[j]))



TransactionManager.Instance.TransactionTaskDone()

#Assign your outputs to the OUT variable
OUT = loads
# ----------------------------------------
code_block_2 = CodeBlock(Out_Name=python_script) { Out_Name[1]; }

# group: ASSIGN LOAD TYPE (DL,SDL,LL) AND DESCRIPTION
code_block_3 = CodeBlock { "Load Case"; }
categories = Categories("LoadCases")
all_elements_of_category = ElementsOfCategory(categories)
code_block_4 = CodeBlock(a=all_elements_of_category) { {a[0], a[5], a[1]}; }
setParameterByName = Element.SetParameterByName(element=python_script_3, parameterName=code_block_3, value=code_block_4)
transpose = List.Transpose(python_script_3)
code_block_5 = CodeBlock { "Description"; }
setParameterByName_2 = Element.SetParameterByName(element=transpose, parameterName=code_block_5, value=code_block_2)

name = Element.Name(all_elements_of_category)
code_block_6 = CodeBlock(Out_Elements=python_script) { Out_Elements[0]; }

# group: THESE ARE THE DL, SDL AND LL PARAMETERS
code_block_7 = CodeBlock { {"DL","SDL","LL"}; }

getParameterValueByName = Element.GetParameterValueByName(element=code_block_6, parameterName=code_block_7@L1)

# group: CREATE AREA LOADS
element_types = ElementTypes("AreaLoadType")
all_elements_of_type = ElementsOfType(element_types)
byCoordinates = Point.ByCoordinates(z=getParameterValueByName)

name_2 = Element.Name(all_elements_of_type)
python_script_4 = Python(IN[0]=getParameterValueByName)
# ---------- python_script_4.python (29 lines) ----------
import clr
clr.AddReference('ProtoGeometry')
from Autodesk.DesignScript.Geometry import *
clr.AddReference('RevitAPI')
from Autodesk.Revit.DB import *

clr.AddReference("RevitServices")
import RevitServices
from RevitServices.Persistence import DocumentManager
doc = DocumentManager.Instance.CurrentDBDocument
#The inputs to this node will be stored as a list in the IN variables.

values = IN[0]

converted = []

getDocUnits = doc.GetUnits()
getDisplayUnits = getDocUnits.GetFormatOptions(UnitType.UT_Length).DisplayUnits

for i in range(0,len(values)):
	con = []
	converted.append(con)
	for j in range(0,len(values[i])):
		#con.append(UnitUtils.ConvertFromInternalUnits(values[i][j], getDisplayUnits))
		con.append(UnitUtils.ConvertToInternalUnits(values[i][j], getDisplayUnits))
	

#Assign your output to the OUT variable.
OUT = converted
# ----------------------------------------
categories_2 = Categories("Areas")
all_elements_of_category_2 = ElementsOfCategory(categories_2)
python_script_5 = Python(IN[0]=all_elements_of_category_2, IN[1]=all_elements_of_type, IN[2]=byCoordinates)
# ---------- python_script_5.python (51 lines) ----------
import clr
clr.AddReference('ProtoGeometry')
from Autodesk.DesignScript.Geometry import *
#Import ToDSType(bool) extension method
clr.AddReference('RevitNodes')
import Revit
clr.ImportExtensions(Revit.GeometryConversion)
#Import DocumentManager and TransactionManager
clr.AddReference('RevitServices')
import RevitServices
from RevitServices.Persistence import DocumentManager
from RevitServices.Transactions import TransactionManager
from System.Collections.Generic import *
#import RevitAPI
clr.AddReference('RevitAPI')
import Autodesk
from Autodesk.Revit.DB import *
from Autodesk.Revit.DB.Structure import *
from System.Collections.Generic import *

doc = DocumentManager.Instance.CurrentDBDocument
uiapp = DocumentManager.Instance.CurrentUIApplication
app = uiapp.Application
activeViewId = doc.ActiveView.Id;

area = UnwrapElement(IN[0])

areaLoadType = UnwrapElement(IN[1])

F = IN[2]

opt = SpatialElementBoundaryOptions()
opt.StoreFreeBoundaryFaces = False
opt.SpatialElementBoundaryLocation.Center

listLoad = []

TransactionManager.Instance.EnsureInTransaction(doc)

for i in range(0,len(area)):
	profileLoops = []
	listLoad.append(profileLoops)
	listLoad.append(area[i].GetBoundarySegments(opt))


#	listLoad.append(AreaLoad.Create(doc,profileLoops,F[0][0].ToXyz(False),areaLoadType[0]))


TransactionManager.Instance.TransactionTaskDone()

OUT = listLoad
# ----------------------------------------
