# Dynamo graph Create_Line_Loads.dyn (Dynamo 1.3.1.1736)

# group: SELECT WALLS
select_model_elements = DSModelElementsSelection()  # 3 picked in the model

getLocation = Element.GetLocation(select_model_elements)
code_block = CodeBlock { {0,1}; }
pointAtParameter = Curve.PointAtParameter(curve=getLocation, param=code_block, lacing=CrossProduct)
code_block_2 = CodeBlock { 0.003281; }
scale = Geometry.Scale(geometry=pointAtParameter, amount=code_block_2)

# group: Line Load Type
element_types = ElementTypes("LineLoadType")
all_elements_of_type = ElementsOfType(element_types)
name = Element.Name(all_elements_of_type)

XY = Plane.XY()
# note: Create(Document, XYZ, XYZ, XYZ, XYZ, LineLoadType, SketchPlane)
byPlane = SketchPlane.ByPlane(XY)

# group: Force Load
code_block_3 = CodeBlock { -5000; }
byCoordinates = Point.ByCoordinates(z=code_block_3)

# group: Moment Load
byCoordinates_2 = Point.ByCoordinates()

assign_area_load_python_script = Python(IN[0]=scale, IN[1]=all_elements_of_type, IN[2]=byPlane, IN[3]=byCoordinates, IN[4]=byCoordinates_2)
# ---------- assign_area_load_python_script.python (59 lines) ----------
import clr
clr.AddReference('ProtoGeometry')
from Autodesk.DesignScript.Geometry import *
#Import ToDSType(bool) extension method
clr.AddReference('RevitNodes')
import Revit
clr.ImportExtensions(Revit.GeometryConversion)
#Import DocumentManager and TransactionManager
clr.AddReference('RevitServices')
import RevitServices
from RevitServices.Persistence import DocumentManager
from RevitServices.Transactions import TransactionManager
from System.Collections.Generic import *
#import RevitAPI
clr.AddReference('RevitAPI')
import Autodesk
from Autodesk.Revit.DB import *
from Autodesk.Revit.DB.Structure import *
from System.Collections.Generic import *

doc = DocumentManager.Instance.CurrentDBDocument


#List of start and end points for each wall
pts = UnwrapElement(IN[0])

#Line load Type
loadtype=UnwrapElement(IN[1])

#List of Sketchplanes. "None" to use the default
skPlane= UnwrapElement(IN[2])

#LoadValues
forceLoad = UnwrapElement(IN[3])
momentLoad = UnwrapElement(IN[4])

TransactionManager.Instance.EnsureInTransaction(doc)

"""
loads=[]

for j in range(0,len(loadtype)):
	listLoad = []
	loads.append(listLoad)
	for i in range(0,len(pl)):
		a= AreaLoad.Create(doc,pl[i],F[j][i].ToXyz(False),loadtype[j])	
		listLoad.append(a)
"""
loads=[]
for i in range(0,len(pts)):
	a = LineLoad.Create(doc, pts[i][0].ToXyz(False), pts[i][1].ToXyz(False), forceLoad.ToXyz(False),momentLoad.ToXyz(False), loadtype[0], skPlane)
	loads.append(a)



TransactionManager.Instance.TransactionTaskDone()

#Assign your output to the OUT variable.
OUT = loads
# ----------------------------------------
