# Dynamo graph regex.dyn (Dynamo 1.3.1.1736)

string = StringInput("^([\w\-]+)")
select_model_elements = DSModelElementsSelection()
code_block = CodeBlock { "Loading Diagrams - Legend Multi"; }
getParameterValueByName = Element.GetParameterValueByName(element=select_model_elements, parameterName=code_block)
findRegularExpression = Custom[String.FindRegularExpression](RegEx=string, str=getParameterValueByName)  # Returns all occurences of a regular expression within a string (or list of strings). The syntax for regular expressions is explained at http://ironpython-test.readthedocs.org/en/latest/howto/regex.html
string_2 = StringInput("([\d.]+)")
findRegularExpression_2 = Custom[String.FindRegularExpression](RegEx=string_2, str=getParameterValueByName)
code_block_2 = CodeBlock { 0; }
getItemAtIndex = List.GetItemAtIndex(list=findRegularExpression_2@@L2, index=code_block_2)
addItemToFront = List.AddItemToFront(item=findRegularExpression@L1, list=getItemAtIndex, lacing=Longest)
string_3 = StringInput("([\d.]+)")
regExExpression = DynamoUnchained.ZeroTouch.HelloDynamo.RegExExpression(getParameterValueByName)
python_script = Python()  # unwired: IN[0]
# ---------- python_script.python (7 lines) ----------
import clr
import sys
sys.path.append(r'C:\Users\giovanni.brogiolo\Dropbox')

import dypy
  
OUT = dypy.summary
# ----------------------------------------
