# Dynamo graph Add View Filters.dyn (Dynamo 1.3.1.1736)

get_revit_activeview = Custom[Get Revit ActiveView]()  # Active View
categories = Categories("AreaLoads")
all_elements_of_category = ElementsOfCategory(categories)
code_block = CodeBlock { "Description"; }
getParameterValueByName = Element.GetParameterValueByName(element=all_elements_of_category, parameterName=code_block)
uniqueItems = List.UniqueItems(getParameterValueByName)
select_rule_type = RuleTypes("Equals")
code_block_2 = CodeBlock(a=all_elements_of_category) { a[0]; }
string = StringInput("Description")
parameterByName = Parameter.ParameterByName(element=code_block_2, name=string)
byRuleType = Revit.Filter.FilterRule.ByRuleType(select_rule_type, uniqueItems, parameterByName@L2, lacing=Longest)
byRules = Revit.Filter.ParameterFilterElement.ByRules(uniqueItems, categories, byRuleType)
addFilter = View.AddFilter(get_revit_activeview, byRules)
red = Custom[Color.Red]()  # Returns the colour red.
blue = Custom[Color.Blue]()  # Returns the colour blue.
green = Custom[Color.Green]()  # Returns the colour green.
create = List.Create(red, blue, green)
byProperties = Revit.Filter.OverrideGraphicSettings.ByProperties(arg3=create)
code_block_3 = CodeBlock { true; }
setFilterOverrides = View.SetFilterOverrides(view=get_revit_activeview, parameterFilter=byRules, overrides=byProperties, hide=code_block_3)
