# Dynamo graph Create_Area_Loads07.dyn (Dynamo 1.3.1.1736)

code_block = CodeBlock { 1; }
lunchbox_area_element_collector = Custom[LunchBox Area Element Collector](Toggle=code_block)  # Collects rooms from the Revit document
code_block_2 = CodeBlock(A=lunchbox_area_element_collector.Boundaries) { A; }

# group: GET THE BOUNDARY LINES END POINTS AND COPY THE FIRST POINT TO THE END OF THE LIST. (NEEDED FOR THE CREATE BOUND METHOD)
flatten = Flatten(code_block_2@L3)
endPoint = Curve.EndPoint(flatten)
python_script = Python(IN[0]=endPoint)
# ---------- python_script.python (8 lines) ----------
list = IN[0]

for l in list:
	l.append(l[0])



OUT = list
# ----------------------------------------

# group: THESE ARE THE DL, SDL AND LL PARAMETERS
code_block_3 = CodeBlock { {"DL","SDL","LL"}; }

# group: FROM MEPOVER
getParameterAsProjectUnits = Custom[GetParameterAsProjectUnits](Elements=lunchbox_area_element_collector.Element, ParameterName=code_block_3)  # Returns the parameter value in the same unit type as the project settings

convert_between_units = DynamoConvert(getParameterAsProjectUnits, conversionMetric=Length, conversionFrom=Feet, conversionTo=Meters)
code_block_4 = CodeBlock(a=convert_between_units) { a*1000; }

# group: CREATE A AREA LOADS
element_types = ElementTypes("AreaLoadType")
all_elements_of_type = ElementsOfType(element_types)
code_block_5 = CodeBlock { 0.003281; }
scale = Geometry.Scale(geometry=python_script, amount=code_block_5)
byCoordinates = Point.ByCoordinates(z=code_block_4)
assign_area_load_python_script = Python(IN[0]=scale, IN[1]=byCoordinates, IN[2]=all_elements_of_type)
# ---------- assign_area_load_python_script.python (69 lines) ----------
import clr
clr.AddReference('ProtoGeometry')
from Autodesk.DesignScript.Geometry import *
#Import ToDSType(bool) extension method
clr.AddReference('RevitNodes')
import Revit
clr.ImportExtensions(Revit.GeometryConversion)
#Import DocumentManager and TransactionManager
clr.AddReference('RevitServices')
import RevitServices
from RevitServices.Persistence import DocumentManager
from RevitServices.Transactions import TransactionManager
from System.Collections.Generic import *
#import RevitAPI
clr.AddReference('RevitAPI')
import Autodesk
from Autodesk.Revit.DB import *
from Autodesk.Revit.DB.Structure import *
from System.Collections.Generic import *

doc = DocumentManager.Instance.CurrentDBDocument

#The inputs to this node will be stored as a list in the IN variables.
#Host=UnwrapElement(IN[0])

pts = UnwrapElement(IN[0])
F=IN[1]
loadtype=UnwrapElement(IN[2])

TransactionManager.Instance.EnsureInTransaction(doc)

#Profile Loop Container
pl = []

#create filled region
for j in range(0,len(pts)):
	outerProfileLoop = CurveLoop()
	pl.Add([outerProfileLoop])
	for i in range(0,len(pts[j])-1):
		outerProfileLoop.Append(Autodesk.Revit.DB.Line.CreateBound(XYZ(pts[j][i].X,pts[j][i].Y,pts[j][i].Z),XYZ(pts[j][i+1].X,pts[j][i+1].Y,pts[j][i+1].Z)))


loads=[]

for j in range(0,len(loadtype)):
	listLoad = []
	loads.append(listLoad)
	for i in range(0,len(pl)):
		a= AreaLoad.Create(doc,pl[i],F[j][i].ToXyz(False),loadtype[j])	
		listLoad.append(a)


"""
for i in range(0,len(pl)):
	a= AreaLoad.Create(doc,pl[i],F[i].ToXyz(False),loadtype)	
	loads.append(a)
"""

"""
for p in pl:
	a= AreaLoad.Create(doc,p,F,loadtype)	
	loads.append(a)
"""
#End Transaction

TransactionManager.Instance.TransactionTaskDone()

#Assign your output to the OUT variable.
OUT = loads
# ----------------------------------------

name = Element.Name(all_elements_of_type)

# group: ASSIGN LOAD TYPE (DL,SDL,LL) AND DESCRIPTION
code_block_6 = CodeBlock { "Load Case"; }
categories = Categories("LoadCases")
all_elements_of_category = ElementsOfCategory(categories)
code_block_7 = CodeBlock(a=all_elements_of_category) { {a[0], a[5], a[1]}; }
setParameterByName = Element.SetParameterByName(element=assign_area_load_python_script, parameterName=code_block_6, value=code_block_7)
transpose = List.Transpose(assign_area_load_python_script)
code_block_8 = CodeBlock { "Description"; }
setParameterByName_2 = Element.SetParameterByName(element=transpose, parameterName=code_block_8, value=lunchbox_area_element_collector.Name)

name_2 = Element.Name(all_elements_of_category)

# group: OPTION 1 - SELECT LINKED ROOMS
get_loaded_rvt_links = Custom[Get Loaded RVT Links]()
code_block_9 = CodeBlock(A=get_loaded_rvt_links.loaded_Link_Docs) { A[0]; }
categories_2 = Categories("Rooms")
get_all_elements_from_linked = Custom[Get All Elements From Linked Model](LinkDoc=code_block_9, Category=categories_2)  # This node is based on code posted by Julien Benoit. Big thanks to Julien for sharing his work. This node will retrieve all elements of a given category from a given linked model.

code_block_10 = CodeBlock { "Level"; }
getParameterValueByName = Element.GetParameterValueByName(element=get_all_elements_from_linked, parameterName=code_block_10)
code_block_11 = CodeBlock { "01"; }
contains = String.Contains(str=getParameterValueByName, searchFor=code_block_11)
filterByBoolMask = List.FilterByBoolMask(list=get_all_elements_from_linked, mask=contains)

# group: EXTRACT THE ROOM CENTER BOUNDARIES, KEEP ONLY THE OUTER LINES (AT INDEX 0) AND GROUP THEM
centerBoundary = Room.CenterBoundary(filterByBoolMask.in)
code_block_12 = CodeBlock { 0; }
getItemAtIndex = List.GetItemAtIndex(list=centerBoundary, index=code_block_12, lacing=Longest)
group_curves = Custom[Group Curves](Curves=getItemAtIndex, lacing=Longest)  # This node will take any input of flat list of curves and group them into sublists containing "joinable" curves that is continous curves. They might form closed curves or open curves. Use PolyCurve.ByJoinedCurves to convert output groups of curves into single PolyCurves

levels = Levels()
plane = Custom[Level.Plane](level=levels)  # Retrieves the plane of a given level
byPlane = SketchPlane.ByPlane(plane)
get_revit_activeview = Custom[Get Revit ActiveView]()  # Active View
fromCurve = Custom[AreaSeparator.FromCurve](curve=group_curves, sketchPlane=byPlane, areaPlanView=get_revit_activeview)  # Creates area separation lines from geometry curves.

# group: SELECT WALLS
select_model_elements = DSModelElementsSelection()  # 6 picked in the model

getLocation = Element.GetLocation(select_model_elements)
code_block_13 = CodeBlock { {0,1}; }
pointAtParameter = Curve.PointAtParameter(curve=getLocation, param=code_block_13, lacing=CrossProduct)
code_block_14 = CodeBlock { 0.003281; }
scale_2 = Geometry.Scale(geometry=pointAtParameter, amount=code_block_14)

# group: Line Load Type
element_types_2 = ElementTypes("LineLoadType")
all_elements_of_type_2 = ElementsOfType(element_types_2)
name_3 = Element.Name(all_elements_of_type_2)

XY = Plane.XY()
# note: Create(Document, XYZ, XYZ, XYZ, XYZ, LineLoadType, SketchPlane)
byPlane_2 = SketchPlane.ByPlane(XY)

# group: Force Load
code_block_15 = CodeBlock { -1000; }
byCoordinates_2 = Point.ByCoordinates(z=code_block_15)

# group: Moment Load
byCoordinates_3 = Point.ByCoordinates()

assign_area_load_python_script_2 = Python(IN[0]=scale_2, IN[1]=all_elements_of_type_2, IN[2]=byPlane_2, IN[3]=byCoordinates_2, IN[4]=byCoordinates_3)
# ---------- assign_area_load_python_script_2.python (59 lines) ----------
import clr
clr.AddReference('ProtoGeometry')
from Autodesk.DesignScript.Geometry import *
#Import ToDSType(bool) extension method
clr.AddReference('RevitNodes')
import Revit
clr.ImportExtensions(Revit.GeometryConversion)
#Import DocumentManager and TransactionManager
clr.AddReference('RevitServices')
import RevitServices
from RevitServices.Persistence import DocumentManager
from RevitServices.Transactions import TransactionManager
from System.Collections.Generic import *
#import RevitAPI
clr.AddReference('RevitAPI')
import Autodesk
from Autodesk.Revit.DB import *
from Autodesk.Revit.DB.Structure import *
from System.Collections.Generic import *

doc = DocumentManager.Instance.CurrentDBDocument


#List of start and end points for each wall
pts = UnwrapElement(IN[0])

#Line load Type
loadtype=UnwrapElement(IN[1])

#List of Sketchplanes. "None" to use the default
skPlane= UnwrapElement(IN[2])

#LoadValues
forceLoad = UnwrapElement(IN[3])
momentLoad = UnwrapElement(IN[4])

TransactionManager.Instance.EnsureInTransaction(doc)

"""
loads=[]

for j in range(0,len(loadtype)):
	listLoad = []
	loads.append(listLoad)
	for i in range(0,len(pl)):
		a= AreaLoad.Create(doc,pl[i],F[j][i].ToXyz(False),loadtype[j])	
		listLoad.append(a)
"""
loads=[]
for i in range(0,len(pts)):
	a = LineLoad.Create(doc, pts[i][0].ToXyz(False), pts[i][1].ToXyz(False), forceLoad.ToXyz(False),momentLoad.ToXyz(False), loadtype[0], skPlane)
	loads.append(a)



TransactionManager.Instance.TransactionTaskDone()

#Assign your output to the OUT variable.
OUT = loads
# ----------------------------------------
