# Dynamo graph Create_Hosted_Area_Loads.dyn (Dynamo 1.3.1.1736)

select_model_elements = DSModelElementsSelection()  # 8 picked in the model
assign_area_load_python_script = Python(IN[0]=select_model_elements)
# ---------- assign_area_load_python_script.python (31 lines) ----------
import clr
clr.AddReference('ProtoGeometry')
from Autodesk.DesignScript.Geometry import *
#Import ToDSType(bool) extension method
clr.AddReference('RevitNodes')
import Revit
clr.ImportExtensions(Revit.GeometryConversion)
#Import DocumentManager and TransactionManager
clr.AddReference('RevitServices')
import RevitServices
from RevitServices.Persistence import DocumentManager
from RevitServices.Transactions import TransactionManager
from System.Collections.Generic import *
#import RevitAPI
clr.AddReference('RevitAPI')
import Autodesk
from Autodesk.Revit.DB import *
from Autodesk.Revit.DB.Structure import *
from System.Collections.Generic import *

doc = DocumentManager.Instance.CurrentDBDocument

#The inputs to this node will be stored as a list in the IN variables.
#Host=UnwrapElement(IN[0])
areaLoad = UnwrapElement(IN[0])



	
#Assign your output to the OUT variable.
OUT = AreaLoad.GetLoops(areaLoad)
# ----------------------------------------
select_model_element = DSModelElementSelection()  # 1 picked in the model
select_model_element_2 = DSModelElementSelection()  # 1 picked in the model
finishBoundary = Room.FinishBoundary(select_model_element_2)
code_block = CodeBlock(A=finishBoundary) { A[0]; }

# group: GROUP CURVES
python_script = Python(IN[0]=code_block)
# ---------- python_script.python (35 lines) ----------
#Copyright(c) 2015, Konrad Sobon
# @arch_laboratory, http://archi-lab.net

import clr
clr.AddReference('ProtoGeometry')
from Autodesk.DesignScript.Geometry import *

#The inputs to this node will be stored as a list in the IN variable.
dataEnteringNode = IN

inputCurves = IN[0]

#join/group curves function
def groupCurves(Line_List): 
	ignore_distance = 0.1 # Assume points this close or closer to each other are touching 
	Grouped_Lines = [] 
	Queue = set() 
	while Line_List: 
		Shape = [] 
		Queue.add(Line_List.pop()) # Move a line from the Line_List to our queue 
		while Queue: 
			Current_Line = Queue.pop() 
			Shape.append(Current_Line) 
			for Potential_Match in Line_List: 
				Points = (Potential_Match.StartPoint, Potential_Match.EndPoint)
				for P1 in Points: 
					for P2 in (Current_Line.StartPoint, Current_Line.EndPoint): 
						distance = P1.DistanceTo(P2) 
						if distance <= ignore_distance: 
							Queue.add(Potential_Match) 
			Line_List = [item for item in Line_List if item not in Queue]
		Grouped_Lines.append(Shape) 
	return Grouped_Lines

OUT = groupCurves(inputCurves)
# ----------------------------------------

curve_loop = Python(IN[0]=python_script)
# ---------- curve_loop.python (49 lines) ----------
import clr
clr.AddReference('ProtoGeometry')
from Autodesk.DesignScript.Geometry import *
#Import ToDSType(bool) extension method
clr.AddReference('RevitNodes')
import Revit
clr.ImportExtensions(Revit.GeometryConversion)
#Import DocumentManager and TransactionManager
clr.AddReference('RevitServices')
import RevitServices
from RevitServices.Persistence import DocumentManager
from RevitServices.Transactions import TransactionManager
from System.Collections.Generic import *
#import RevitAPI
clr.AddReference('RevitAPI')
import Autodesk
from Autodesk.Revit.DB import *
from Autodesk.Revit.DB.Structure import *
from System.Collections.Generic import *

doc = DocumentManager.Instance.CurrentDBDocument

#The inputs to this node will be stored as a list in the IN variables.
#Host=UnwrapElement(IN[0])

crvs = IN[0]

loop = CurveLoop()

crvsLoop = loop.CreateViaCopy(crvs)



	
"""
loads=[]

for i in outerProfileLoop:
	#Start Transaction
	doc = DocumentManager.Instance.CurrentDBDocument
	TransactionManager.Instance.EnsureInTransaction(doc)
	a= AreaLoad.Create(doc,i,F,loadtype)
	loads.append(a)
	
#End Transaction
TransactionManager.Instance.TransactionTaskDone()
	"""
#Assign your output to the OUT variable.
OUT = outerProfileLoop
# ----------------------------------------
python_script_2 = Python()  # unwired: IN[0], IN[1], IN[2]
# ---------- python_script_2.python (57 lines) ----------
import clr
clr.AddReference('ProtoGeometry')
from Autodesk.DesignScript.Geometry import *

# Import DocumentManager and TransactionManager
clr.AddReference("RevitServices")
import RevitServices
from RevitServices.Persistence import DocumentManager
from RevitServices.Transactions import TransactionManager

# Import RevitAPI
clr.AddReference("RevitAPI")
import Autodesk
from Autodesk.Revit.DB import *

doc = DocumentManager.Instance.CurrentDBDocument
uiapp = DocumentManager.Instance.CurrentUIApplication
app = uiapp.Application


regions = []
activeViewId = doc.ActiveView.Id;

TransactionManager.Instance.EnsureInTransaction(doc)

pts = UnwrapElement(IN[0])
innerPts = UnwrapElement(IN[1])

frt = UnwrapElement(IN[2])


profileLoops = []
outerProfileLoop = CurveLoop()
#innerProfileLoop = CurveLoop()

profileLoops.Add(outerProfileLoop)
#profileLoops.Add(innerProfileLoop)


#create filled region
for i in range(0,len(pts)-1):
	outerProfileLoop.Append(Autodesk.Revit.DB.Line.CreateBound(XYZ(pts[i].X,pts[i].Y,pts[i].Z),XYZ(pts[i+1].X,pts[i+1].Y,pts[i+1].Z)))

for j in range(0,len(innerPts)):
	innerProfileLoop = CurveLoop()
	profileLoops.Add(innerProfileLoop)
	for i in range(0,len(innerPts[j])-1):
		innerProfileLoop.Append(Autodesk.Revit.DB.Line.CreateBound(XYZ(innerPts[j][i].X,innerPts[j][i].Y,innerPts[j][i].Z),XYZ(innerPts[j][i+1].X,innerPts[j][i+1].Y,innerPts[j][i+1].Z)))


region = FilledRegion.Create(doc,frt[0].Id,activeViewId,profileLoops)
regions.Add(region)

TransactionManager.Instance.TransactionTaskDone()

#Assign your outputs to the OUT variable
OUT = regions
# ----------------------------------------
get_loaded_rvt_links = Custom[Get Loaded RVT Links]()
code_block_2 = CodeBlock(A=get_loaded_rvt_links.loaded_Link_Docs) { A[0]; }
categories = Categories("Rooms")
get_all_elements_from_linked = Custom[Get All Elements From Linked Model](LinkDoc=code_block_2, Category=categories)  # This node is based on code posted by Julien Benoit. Big thanks to Julien for sharing his work. This node will retrieve all elements of a given category from a given linked model.
code_block_3 = CodeBlock(A=get_all_elements_from_linked) { A[0]; }
python_script_3 = Python()  # unwired: IN[0]
# ---------- python_script_3.python (36 lines) ----------
 
import clr
# Import RevitAPI
clr.AddReference("RevitAPI")
import Autodesk
from Autodesk.Revit.DB import *
 
# Import ToDSType(bool) extension method, not sure we need this
clr.AddReference("RevitNodes")
import Revit
clr.ImportExtensions(Revit.Elements)
# Make sure the GeometryConversion utilities are accesible see https://github.com/DynamoDS/Dynamo/issues/1946
clr.ImportExtensions(Revit.GeometryConversion) 
 
# Unwrap
rooms = []
for i in IN[0]:
	rooms.append(UnwrapElement(i)) #This kind of opens the Revit element so it can be used by Dynamo Script
# Curve array
curves = []
# Boundary options for rooms
opt = SpatialElementBoundaryOptions()
# Iterate through every room
for room in rooms:
	if room.Area > 0: # Make sure it has positive Area, i.e is placed
		rvBoundary = room.GetBoundarySegments(opt) # Get room boundary
		dsBoundary = [] # A Dynamo list to hold the boundary per room, remember it can be complex, with holes		
		for rvLoop in rvBoundary: # For each loop in the room boundary
			dsLoop = [] # A list to hold each room's loop
			for rvPiece in rvLoop:	# Retrieve each segment of the loop
				dsPiece = Revit.GeometryConversion.RevitToProtoCurve.ToProtoType(rvPiece.Curve,True) # Read the segment as Curve and convert to Dynamo geometry
				dsLoop.append(dsPiece) # Add the piece to the Dynamo Loop
			dsBoundary.Add(dsLoop) # Add the Dynamo Loop to the Dynamo Boundary
		curves.append(dsBoundary) # Add the Dynamo Boundary per room to the Curves list
#Output
OUT = curves
# ----------------------------------------
code_block_4 = CodeBlock { -4.8; }
convert_between_units = DynamoConvert(code_block_4, conversionMetric=Length, conversionFrom=Feet, conversionTo=Millimeters)
watch = Watch(convert_between_units)
byCoordinates = Point.ByCoordinates(z=watch)
element_types = ElementTypes("AreaLoadType")
all_elements_of_type = ElementsOfType(element_types)
firstItem = List.FirstItem(all_elements_of_type)

# group: works for one area
assign_area_load_python_script_2 = Python(IN[1]=byCoordinates, IN[2]=firstItem)  # unwired: IN[0]
# ---------- assign_area_load_python_script_2.python (53 lines) ----------
import clr
clr.AddReference('ProtoGeometry')
from Autodesk.DesignScript.Geometry import *
#Import ToDSType(bool) extension method
clr.AddReference('RevitNodes')
import Revit
clr.ImportExtensions(Revit.GeometryConversion)
#Import DocumentManager and TransactionManager
clr.AddReference('RevitServices')
import RevitServices
from RevitServices.Persistence import DocumentManager
from RevitServices.Transactions import TransactionManager
from System.Collections.Generic import *
#import RevitAPI
clr.AddReference('RevitAPI')
import Autodesk
from Autodesk.Revit.DB import *
from Autodesk.Revit.DB.Structure import *
from System.Collections.Generic import *

doc = DocumentManager.Instance.CurrentDBDocument

#The inputs to this node will be stored as a list in the IN variables.
#Host=UnwrapElement(IN[0])

pts = UnwrapElement(IN[0])
F=IN[1].ToXyz(False)
loadtype=UnwrapElement(IN[2])

TransactionManager.Instance.EnsureInTransaction(doc)

profileLoops = []

outerProfileLoop = CurveLoop()

profileLoops.Add(outerProfileLoop)



#create filled region
for i in range(0,len(pts)-1):
	outerProfileLoop.Append(Autodesk.Revit.DB.Line.CreateBound(XYZ(pts[i].X,pts[i].Y,pts[i].Z),XYZ(pts[i+1].X,pts[i+1].Y,pts[i+1].Z)))

loads=[]

a= AreaLoad.Create(doc,profileLoops,F,loadtype)	
loads.append(a)

#End Transaction
TransactionManager.Instance.TransactionTaskDone()

#Assign your output to the OUT variable.
OUT = profileLoops,loads
# ----------------------------------------

curves = Element.Curves(select_model_elements)
flatten = Flatten(curves)
python_script_4 = Python(IN[0]=flatten)  # same code as python_script
endPoint = Curve.EndPoint(python_script_4)
python_script_5 = Python(IN[0]=endPoint)
# ---------- python_script_5.python (8 lines) ----------
list = IN[0]

for l in list:
	l.append(l[0])



OUT = list
# ----------------------------------------
assign_area_load_python_script_3 = Python(IN[0]=python_script_5)
# ---------- assign_area_load_python_script_3.python (48 lines) ----------
import clr
clr.AddReference('ProtoGeometry')
from Autodesk.DesignScript.Geometry import *
#Import ToDSType(bool) extension method
clr.AddReference('RevitNodes')
import Revit
clr.ImportExtensions(Revit.GeometryConversion)
#Import DocumentManager and TransactionManager
clr.AddReference('RevitServices')
import RevitServices
from RevitServices.Persistence import DocumentManager
from RevitServices.Transactions import TransactionManager
from System.Collections.Generic import *
#import RevitAPI
clr.AddReference('RevitAPI')
import Autodesk
from Autodesk.Revit.DB import *
from Autodesk.Revit.DB.Structure import *
from System.Collections.Generic import *

doc = DocumentManager.Instance.CurrentDBDocument

#The inputs to this node will be stored as a list in the IN variables.
#Host=UnwrapElement(IN[0])

pts = UnwrapElement(IN[0])


profileLoops = []

outerProfileLoop = CurveLoop()

profileLoops.Add(outerProfileLoop)


pl = []

#create filled region
for j in range(0,len(pts)):
	
	outerProfileLoop = CurveLoop()
	pl.Add(outerProfileLoop)
	for i in range(0,len(pts[j])-1):
		outerProfileLoop.Append(Autodesk.Revit.DB.Line.CreateBound(XYZ(pts[j][i].X,pts[j][i].Y,pts[j][i].Z),XYZ(pts[j][i+1].X,pts[j][i+1].Y,pts[j][i+1].Z)))


#Assign your output to the OUT variable.
OUT = pl
# ----------------------------------------
categories_2 = Categories("FloorAnalytical")
all_elements_of_category = ElementsOfCategory(categories_2)
code_block_5 = CodeBlock { -4.8; }
convert_between_units_2 = DynamoConvert(code_block_5, conversionMetric=Length, conversionFrom=Feet, conversionTo=Millimeters)
watch_2 = Watch(convert_between_units_2)
byCoordinates_2 = Point.ByCoordinates(z=watch_2)
element_types_2 = ElementTypes("AreaLoadType")
all_elements_of_type_2 = ElementsOfType(element_types_2)
firstItem_2 = List.FirstItem(all_elements_of_type_2)
assign_area_load_python_script_4 = Python(IN[1]=byCoordinates_2, IN[2]=firstItem_2)  # unwired: IN[0]
# ---------- assign_area_load_python_script_4.python (41 lines) ----------
import clr
clr.AddReference('ProtoGeometry')
from Autodesk.DesignScript.Geometry import *
#Import ToDSType(bool) extension method
clr.AddReference('RevitNodes')
import Revit
clr.ImportExtensions(Revit.GeometryConversion)
#Import DocumentManager and TransactionManager
clr.AddReference('RevitServices')
import RevitServices
from RevitServices.Persistence import DocumentManager
from RevitServices.Transactions import TransactionManager
from System.Collections.Generic import *
#import RevitAPI
clr.AddReference('RevitAPI')
import Autodesk
from Autodesk.Revit.DB import *
from Autodesk.Revit.DB.Structure import *
from System.Collections.Generic import *

doc = DocumentManager.Instance.CurrentDBDocument

#The inputs to this node will be stored as a list in the IN variables.
Host=UnwrapElement(IN[0])
F=IN[1].ToXyz(False)
loadtype=UnwrapElement(IN[2])

loads=[]

for i in Host:
	#Start Transaction
	doc = DocumentManager.Instance.CurrentDBDocument
	TransactionManager.Instance.EnsureInTransaction(doc)
	a= AreaLoad.Create(doc,i,F,loadtype)
	loads.append(a)
	
#End Transaction
TransactionManager.Instance.TransactionTaskDone()
	
#Assign your output to the OUT variable.
OUT = loads
# ----------------------------------------
assign_area_load_python_script_5 = Python(IN[1]=byCoordinates, IN[2]=firstItem)  # unwired: IN[0]
# ---------- assign_area_load_python_script_5.python (48 lines) ----------
import clr
clr.AddReference('ProtoGeometry')
from Autodesk.DesignScript.Geometry import *
#Import ToDSType(bool) extension method
clr.AddReference('RevitNodes')
import Revit
clr.ImportExtensions(Revit.GeometryConversion)
#Import DocumentManager and TransactionManager
clr.AddReference('RevitServices')
import RevitServices
from RevitServices.Persistence import DocumentManager
from RevitServices.Transactions import TransactionManager
from System.Collections.Generic import *
#import RevitAPI
clr.AddReference('RevitAPI')
import Autodesk
from Autodesk.Revit.DB import *
from Autodesk.Revit.DB.Structure import *
from System.Collections.Generic import *

doc = DocumentManager.Instance.CurrentDBDocument

#The inputs to this node will be stored as a list in the IN variables.
#Host=UnwrapElement(IN[0])

profileLoops = IN[0]
F=IN[1].ToXyz(False)
loadtype=UnwrapElement(IN[2])



TransactionManager.Instance.EnsureInTransaction(doc)

loads=[]

error = None
	
for i in profileLoops:
	a= AreaLoad.Create(doc,profileLoops,F,loadtype)	
	loads.append(a)

		
		
#End Transaction
TransactionManager.Instance.TransactionTaskDone()

#Assign your output to the OUT variable.
OUT = loads, error
# ----------------------------------------
select_model_elements_2 = DSModelElementsSelection()  # 8 picked in the model
curves_2 = Element.Curves(select_model_elements_2)
flatten_2 = Flatten(curves_2)
python_script_6 = Python(IN[0]=flatten_2)  # same code as python_script
endPoint_2 = Curve.EndPoint(python_script_6)
python_script_7 = Python(IN[0]=endPoint_2)  # same code as python_script_5
code_block_6 = CodeBlock { 0.003281; }
scale = Geometry.Scale(geometry=python_script_7, amount=code_block_6)
assign_area_load_python_script_6 = Python(IN[0]=scale, IN[1]=byCoordinates, IN[2]=firstItem)
# ---------- assign_area_load_python_script_6.python (54 lines) ----------
import clr
clr.AddReference('ProtoGeometry')
from Autodesk.DesignScript.Geometry import *
#Import ToDSType(bool) extension method
clr.AddReference('RevitNodes')
import Revit
clr.ImportExtensions(Revit.GeometryConversion)
#Import DocumentManager and TransactionManager
clr.AddReference('RevitServices')
import RevitServices
from RevitServices.Persistence import DocumentManager
from RevitServices.Transactions import TransactionManager
from System.Collections.Generic import *
#import RevitAPI
clr.AddReference('RevitAPI')
import Autodesk
from Autodesk.Revit.DB import *
from Autodesk.Revit.DB.Structure import *
from System.Collections.Generic import *

doc = DocumentManager.Instance.CurrentDBDocument

#The inputs to this node will be stored as a list in the IN variables.
#Host=UnwrapElement(IN[0])

pts = UnwrapElement(IN[0])
F=IN[1].ToXyz(False)
loadtype=UnwrapElement(IN[2])

TransactionManager.Instance.EnsureInTransaction(doc)

#Profile Loop Container
pl = []

#create filled region
for j in range(0,len(pts)):
	outerProfileLoop = CurveLoop()
	pl.Add([outerProfileLoop])
	for i in range(0,len(pts[j])-1):
		outerProfileLoop.Append(Autodesk.Revit.DB.Line.CreateBound(XYZ(pts[j][i].X,pts[j][i].Y,pts[j][i].Z),XYZ(pts[j][i+1].X,pts[j][i+1].Y,pts[j][i+1].Z)))


loads=[]

for p in pl:
	a= AreaLoad.Create(doc,p,F,loadtype)	
	loads.append(a)

#End Transaction

TransactionManager.Instance.TransactionTaskDone()

#Assign your output to the OUT variable.
OUT = loads
# ----------------------------------------
assign_area_load_python_script_7 = Python(IN[0]=scale)
# ---------- assign_area_load_python_script_7.python (44 lines) ----------
import clr
clr.AddReference('ProtoGeometry')
from Autodesk.DesignScript.Geometry import *
#Import ToDSType(bool) extension method
clr.AddReference('RevitNodes')
import Revit
clr.ImportExtensions(Revit.GeometryConversion)
#Import DocumentManager and TransactionManager
clr.AddReference('RevitServices')
import RevitServices
from RevitServices.Persistence import DocumentManager
from RevitServices.Transactions import TransactionManager
from System.Collections.Generic import *
#import RevitAPI
clr.AddReference('RevitAPI')
import Autodesk
from Autodesk.Revit.DB import *
from Autodesk.Revit.DB.Structure import *
from System.Collections.Generic import *

doc = DocumentManager.Instance.CurrentDBDocument

#The inputs to this node will be stored as a list in the IN variables.
#Host=UnwrapElement(IN[0])

pts = UnwrapElement(IN[0])


profileLoops = []

outerProfileLoop = CurveLoop()

profileLoops.Add(outerProfileLoop)



#create filled region
for j in range(0,len(pts)):
	for i in range(0,len(pts[j])-1):
		outerProfileLoop.Append(Autodesk.Revit.DB.Line.CreateBound(XYZ(pts[j][i].X,pts[j][i].Y,pts[j][i].Z),XYZ(pts[j][i+1].X,pts[j][i+1].Y,pts[j][i+1].Z)))


#Assign your output to the OUT variable.
OUT = profileLoops
# ----------------------------------------
select_model_elements_3 = DSModelElementsSelection()  # 4 picked in the model
curves_3 = Element.Curves(select_model_elements_3)
flatten_3 = Flatten(curves_3)
python_script_8 = Python(IN[0]=flatten_3)  # same code as python_script
endPoint_3 = Curve.EndPoint(python_script_8)
python_script_9 = Python(IN[0]=endPoint_3)  # same code as python_script_5
flatten_4 = Flatten(python_script_9)
code_block_7 = CodeBlock { 0.003281; }
scale_2 = Geometry.Scale(geometry=flatten_4, amount=code_block_7)
