# Dynamo graph Create_Hosted_Area_Loads01.dyn (Dynamo 1.3.1.1736)

# group: OPTION 2 - MANUALLY SELECT LINES
select_model_elements = DSModelElementsSelection()
curves = Element.Curves(select_model_elements)
flatten = Flatten(curves)

# group: GROUP CURVES
python_script = Python(IN[0]=flatten)
# ---------- python_script.python (35 lines) ----------
#Copyright(c) 2015, Konrad Sobon
# @arch_laboratory, http://archi-lab.net

import clr
clr.AddReference('ProtoGeometry')
from Autodesk.DesignScript.Geometry import *

#The inputs to this node will be stored as a list in the IN variable.
dataEnteringNode = IN

inputCurves = IN[0]

#join/group curves function
def groupCurves(Line_List): 
	ignore_distance = 0.1 # Assume points this close or closer to each other are touching 
	Grouped_Lines = [] 
	Queue = set() 
	while Line_List: 
		Shape = [] 
		Queue.add(Line_List.pop()) # Move a line from the Line_List to our queue 
		while Queue: 
			Current_Line = Queue.pop() 
			Shape.append(Current_Line) 
			for Potential_Match in Line_List: 
				Points = (Potential_Match.StartPoint, Potential_Match.EndPoint)
				for P1 in Points: 
					for P2 in (Current_Line.StartPoint, Current_Line.EndPoint): 
						distance = P1.DistanceTo(P2) 
						if distance <= ignore_distance: 
							Queue.add(Potential_Match) 
			Line_List = [item for item in Line_List if item not in Queue]
		Grouped_Lines.append(Shape) 
	return Grouped_Lines

OUT = groupCurves(inputCurves)
# ----------------------------------------

# group: OPTION 1 - SELECT LINKED ROOMS
code_block = CodeBlock { A[0..10]; }  # unwired: A
finishBoundary = Room.FinishBoundary()  # unwired: arg0
get_loaded_rvt_links = Custom[Get Loaded RVT Links]()
code_block_2 = CodeBlock(A=get_loaded_rvt_links.loaded_Link_Docs) { A[0]; }
categories = Categories("Rooms")
get_all_elements_from_linked = Custom[Get All Elements From Linked Model](LinkDoc=code_block_2, Category=categories)  # This node is based on code posted by Julien Benoit. Big thanks to Julien for sharing his work. This node will retrieve all elements of a given category from a given linked model.

centerBoundary = Room.CenterBoundary(get_all_elements_from_linked)
code_block_3 = CodeBlock { 0; }
getItemAtIndex = List.GetItemAtIndex(list=centerBoundary, index=code_block_3, lacing=Longest)
group_curves = Custom[Group Curves](Curves=getItemAtIndex, lacing=Longest)  # This node will take any input of flat list of curves and group them into sublists containing "joinable" curves that is continous curves. They might form closed curves or open curves. Use PolyCurve.ByJoinedCurves to convert output groups of curves into single PolyCurves

# group: GROUP CURVES
python_script_2 = Python()  # unwired: IN[0]; same code as python_script

level = Custom[Element.Level](element=get_all_elements_from_linked)  # Gets an element's level
name = Element.Name(level)
code_block_4 = CodeBlock { "02"; }
contains = String.Contains(str=name, searchFor=code_block_4)
filterByBoolMask = List.FilterByBoolMask(list=get_all_elements_from_linked, mask=contains)
centerBoundary_2 = Room.CenterBoundary(filterByBoolMask.in)
code_block_5 = CodeBlock { 0; }
getItemAtIndex_2 = List.GetItemAtIndex(list=centerBoundary_2, index=code_block_5, lacing=Longest)
group_curves_2 = Custom[Group Curves](Curves=getItemAtIndex_2, lacing=Longest)
flatten_2 = Flatten(group_curves_2@L3)
endPoint = Curve.EndPoint(flatten_2)

# group: COPY THE FIRST POINT TO THE END OF THE LIST
python_script_3 = Python(IN[0]=endPoint)
# ---------- python_script_3.python (8 lines) ----------
list = IN[0]

for l in list:
	l.append(l[0])



OUT = list
# ----------------------------------------

code_block_6 = CodeBlock { 0.003281; }
scale = Geometry.Scale(geometry=python_script_3, amount=code_block_6)
code_block_7 = CodeBlock { -1; }
convert_between_units = DynamoConvert(code_block_7, conversionMetric=Length, conversionFrom=Feet, conversionTo=Millimeters)
watch = Watch(convert_between_units)
byCoordinates = Point.ByCoordinates(z=watch)
element_types = ElementTypes("AreaLoadType")
all_elements_of_type = ElementsOfType(element_types)
firstItem = List.FirstItem(all_elements_of_type)
assign_area_load_python_script = Python(IN[0]=scale, IN[1]=byCoordinates, IN[2]=firstItem)
# ---------- assign_area_load_python_script.python (54 lines) ----------
import clr
clr.AddReference('ProtoGeometry')
from Autodesk.DesignScript.Geometry import *
#Import ToDSType(bool) extension method
clr.AddReference('RevitNodes')
import Revit
clr.ImportExtensions(Revit.GeometryConversion)
#Import DocumentManager and TransactionManager
clr.AddReference('RevitServices')
import RevitServices
from RevitServices.Persistence import DocumentManager
from RevitServices.Transactions import TransactionManager
from System.Collections.Generic import *
#import RevitAPI
clr.AddReference('RevitAPI')
import Autodesk
from Autodesk.Revit.DB import *
from Autodesk.Revit.DB.Structure import *
from System.Collections.Generic import *

doc = DocumentManager.Instance.CurrentDBDocument

#The inputs to this node will be stored as a list in the IN variables.
#Host=UnwrapElement(IN[0])

pts = UnwrapElement(IN[0])
F=IN[1].ToXyz(False)
loadtype=UnwrapElement(IN[2])

TransactionManager.Instance.EnsureInTransaction(doc)

#Profile Loop Container
pl = []

#create filled region
for j in range(0,len(pts)):
	outerProfileLoop = CurveLoop()
	pl.Add([outerProfileLoop])
	for i in range(0,len(pts[j])-1):
		outerProfileLoop.Append(Autodesk.Revit.DB.Line.CreateBound(XYZ(pts[j][i].X,pts[j][i].Y,pts[j][i].Z),XYZ(pts[j][i+1].X,pts[j][i+1].Y,pts[j][i+1].Z)))


loads=[]

for p in pl:
	a= AreaLoad.Create(doc,p,F,loadtype)	
	loads.append(a)

#End Transaction

TransactionManager.Instance.TransactionTaskDone()

#Assign your output to the OUT variable.
OUT = loads
# ----------------------------------------
name_2 = Element.Name(filterByBoolMask.in)
python_script_4 = Python(IN[0]=name_2)
# ---------- python_script_4.python (14 lines) ----------
import clr
clr.AddReference('ProtoGeometry')
from Autodesk.DesignScript.Geometry import *
#The inputs to this node will be stored as a list in the IN variables.
names = IN[0]

newNames = []

for n in names:
	splittedNames = n.split()
	newNames.append(splittedNames[0])

#Assign your output to the OUT variable.
OUT = newNames
# ----------------------------------------
uniqueItems = List.UniqueItems(python_script_4)
allIndicesOf = List.AllIndicesOf(list=python_script_4, item=uniqueItems)
getItemAtIndex_3 = List.GetItemAtIndex(list=assign_area_load_python_script, index=allIndicesOf)
code_block_8 = CodeBlock { "Fz 1"; }

# group: ASSIGN LOADS TO ROOM NAMES
code_block_9 = CodeBlock()
# ---------- code_block_9.designscript (17 lines) ----------
{"Admin",
"Caferteria",
"Conference",
"Corridor",
"Dry",
"Electrical",
"Entry",
"Female",
"Instruction",
"Lounge",
"Male",
"Office",
"Prep/Dish",
"Sprinkler",
"Stair",
"Toilet",
"Utility"};
# ----------------------------------------
code_block_10 = CodeBlock { -(1..17)*100; }
convert_between_units_2 = DynamoConvert(code_block_10, conversionMetric=Length, conversionFrom=Feet, conversionTo=Millimeters)
createDictionary = Lists.Dictionary.CreateDictionary(code_block_9, convert_between_units_2)

getItemAtIndex_4 = List.GetItemAtIndex(list=python_script_4, index=allIndicesOf)
getValueFromDictionary = Lists.Dictionary.GetValueFromDictionary(createDictionary, getItemAtIndex_4)
flatten_3 = Flatten(getValueFromDictionary@L2)
setParameterByName = Element.SetParameterByName(element=getItemAtIndex_3, parameterName=code_block_8, value=flatten_3)
