# Dynamo graph Create_Hosted_Area_Loads04.dyn (Dynamo 1.3.1.1736)

code_block = CodeBlock { 1; }
lunchbox_area_element_collector = Custom[LunchBox Area Element Collector](Toggle=code_block)  # Collects rooms from the Revit document
code_block_2 = CodeBlock(A=lunchbox_area_element_collector.Boundaries) { A; }

# group: GET THE BOUNDARY LINES END POINTS AND COPY THE FIRST POINT TO THE END OF THE LIST. (NEEDED FOR THE CREATE BOUND METHOD)
flatten = Flatten(code_block_2@L3)
endPoint = Curve.EndPoint(flatten)
python_script = Python(IN[0]=endPoint)
# ---------- python_script.python (8 lines) ----------
list = IN[0]

for l in list:
	l.append(l[0])



OUT = list
# ----------------------------------------

# group: CREATE A NOMINAL AREA LOAD
code_block_3 = CodeBlock { 0.003281; }
scale = Geometry.Scale(geometry=python_script, amount=code_block_3)
code_block_4 = CodeBlock { -1; }
convert_between_units = DynamoConvert(code_block_4, conversionMetric=Length, conversionFrom=Feet, conversionTo=Millimeters)
watch = Watch(convert_between_units)
byCoordinates = Point.ByCoordinates(z=watch)
element_types = ElementTypes("AreaLoadType")
all_elements_of_type = ElementsOfType(element_types)
firstItem = List.FirstItem(all_elements_of_type)
assign_area_load_python_script = Python(IN[0]=scale, IN[1]=byCoordinates, IN[2]=firstItem)
# ---------- assign_area_load_python_script.python (54 lines) ----------
import clr
clr.AddReference('ProtoGeometry')
from Autodesk.DesignScript.Geometry import *
#Import ToDSType(bool) extension method
clr.AddReference('RevitNodes')
import Revit
clr.ImportExtensions(Revit.GeometryConversion)
#Import DocumentManager and TransactionManager
clr.AddReference('RevitServices')
import RevitServices
from RevitServices.Persistence import DocumentManager
from RevitServices.Transactions import TransactionManager
from System.Collections.Generic import *
#import RevitAPI
clr.AddReference('RevitAPI')
import Autodesk
from Autodesk.Revit.DB import *
from Autodesk.Revit.DB.Structure import *
from System.Collections.Generic import *

doc = DocumentManager.Instance.CurrentDBDocument

#The inputs to this node will be stored as a list in the IN variables.
#Host=UnwrapElement(IN[0])

pts = UnwrapElement(IN[0])
F=IN[1].ToXyz(False)
loadtype=UnwrapElement(IN[2])

TransactionManager.Instance.EnsureInTransaction(doc)

#Profile Loop Container
pl = []

#create filled region
for j in range(0,len(pts)):
	outerProfileLoop = CurveLoop()
	pl.Add([outerProfileLoop])
	for i in range(0,len(pts[j])-1):
		outerProfileLoop.Append(Autodesk.Revit.DB.Line.CreateBound(XYZ(pts[j][i].X,pts[j][i].Y,pts[j][i].Z),XYZ(pts[j][i+1].X,pts[j][i+1].Y,pts[j][i+1].Z)))


loads=[]

for p in pl:
	a= AreaLoad.Create(doc,p,F,loadtype)	
	loads.append(a)

#End Transaction

TransactionManager.Instance.TransactionTaskDone()

#Assign your output to the OUT variable.
OUT = loads
# ----------------------------------------

# group: OPTION 1 - SELECT LINKED ROOMS
get_loaded_rvt_links = Custom[Get Loaded RVT Links]()
code_block_5 = CodeBlock(A=get_loaded_rvt_links.loaded_Link_Docs) { A[0]; }
categories = Categories("Rooms")
get_all_elements_from_linked = Custom[Get All Elements From Linked Model](LinkDoc=code_block_5, Category=categories)  # This node is based on code posted by Julien Benoit. Big thanks to Julien for sharing his work. This node will retrieve all elements of a given category from a given linked model.

# group: CREATE A LEGEND OF ALL THE ROOMS
name = Element.Name(get_all_elements_from_linked)
python_script_2 = Python(IN[0]=name)
# ---------- python_script_2.python (14 lines) ----------
import clr
clr.AddReference('ProtoGeometry')
from Autodesk.DesignScript.Geometry import *
#The inputs to this node will be stored as a list in the IN variables.
names = IN[0]

newNames = []

for n in names:
	splittedNames = n.split()
	newNames.append(splittedNames[0])

#Assign your output to the OUT variable.
OUT = newNames
# ----------------------------------------
uniqueItems = List.UniqueItems(python_script_2)
allIndicesOf = List.AllIndicesOf(list=python_script_2, item=uniqueItems)

# group: SUBDIVIDE THE AREA LOADS BY THEIR ROOM
getItemAtIndex = List.GetItemAtIndex(list=assign_area_load_python_script, index=allIndicesOf)

# group: CREATEA DICTIONARY TO ASSIGN LOADS TO ROOM NAMES
sort = List.Sort(uniqueItems)
code_block_6 = CodeBlock { -(1..10..#28)*2; }
convert_between_units_2 = DynamoConvert(code_block_6, conversionMetric=Length, conversionFrom=Feet, conversionTo=Millimeters)
createDictionary = Lists.Dictionary.CreateDictionary(sort, convert_between_units_2)

# group: GET THE AREA LOAD FOR EACH ROOM TYPE
getItemAtIndex_2 = List.GetItemAtIndex(list=python_script_2, index=allIndicesOf)
getValueFromDictionary = Lists.Dictionary.GetValueFromDictionary(createDictionary, getItemAtIndex_2)
flatten_2 = Flatten(getValueFromDictionary@L2)

# group: WRITE THE AREA LOAD TO Fz1
code_block_7 = CodeBlock { "Fz 1"; }
setParameterByName = Element.SetParameterByName(element=getItemAtIndex, parameterName=code_block_7, value=flatten_2)

levels = Levels()

# group: RHYTHM
areas = Custom[Collector.Areas](Level=levels)  # This is an area collector element that utilizes mostly OOTB nodes.

code_block_8 = CodeBlock(a=areas.areaElements) { {a}; }
python_script_3 = Python(IN[0]=code_block_8)
# ---------- python_script_3.python (52 lines) ----------
import clr
clr.AddReference('RevitAPI')
from Autodesk.Revit.DB import *
import Autodesk

clr.AddReference("RevitNodes")
import Revit
clr.ImportExtensions(Revit.GeometryConversion)

clr.AddReference("RevitServices")
import RevitServices
from RevitServices.Persistence import DocumentManager

uiapp = DocumentManager.Instance.CurrentUIApplication
app = uiapp.Application
items = UnwrapElement(IN[0])
version = app.VersionNumber
elementlist = list()
curvelist = list()

for item in items:
	doc = item.Document
	calculator = SpatialElementGeometryCalculator(doc)
	options = Autodesk.Revit.DB.SpatialElementBoundaryOptions()
	# get boundary location from area computation settings
	boundloc = Autodesk.Revit.DB.AreaVolumeSettings.GetAreaVolumeSettings(doc).GetSpatialElementBoundaryLocation(SpatialElementType.Room)
	options.SpatialElementBoundaryLocation = boundloc
	#method #1 - get boundary segments
	blist = list()
	clist = list()
	try:
		for boundarylist in item.GetBoundarySegments(options):
			for boundary in boundarylist:
				blist.append(doc.GetElement(boundary.ElementId))
				if version > 2016:
					clist.append(boundary.GetCurve().ToProtoType())
				else:
					clist.append(boundary.Curve.ToProtoType())
	except:
		pass
	#method #2 - spatial element geometry calculator
	try:
		results = calculator.CalculateSpatialElementGeometry(item)
		for face in results.GetGeometry().Faces:
			for bface in results.GetBoundaryFaceInfo(face):
				blist.append(doc.GetElement(bface.SpatialBoundaryElement.HostElementId))
	except:
		pass	
	# write results to list
	elementlist.append(blist)
	curvelist.append(clist)
OUT = (elementlist,curvelist)
# ----------------------------------------
code_block_9 = CodeBlock { "Description"; }
setParameterByName_2 = Element.SetParameterByName(element=getItemAtIndex, parameterName=code_block_9, value=getItemAtIndex_2, lacing=Longest)
flatten_3 = Flatten(getItemAtIndex)
