# Dynamo graph Create_Hosted_Area_Loads05.dyn (Dynamo 1.3.1.1736)

levels = Levels("00")

# group: RHYTHM
areas = Custom[Collector.Areas](Level=levels)  # This is an area collector element that utilizes mostly OOTB nodes.

code_block = CodeBlock(a=areas.areaElements) { {a}; }
python_script = Python(IN[0]=code_block)
# ---------- python_script.python (52 lines) ----------
import clr
clr.AddReference('RevitAPI')
from Autodesk.Revit.DB import *
import Autodesk

clr.AddReference("RevitNodes")
import Revit
clr.ImportExtensions(Revit.GeometryConversion)

clr.AddReference("RevitServices")
import RevitServices
from RevitServices.Persistence import DocumentManager

uiapp = DocumentManager.Instance.CurrentUIApplication
app = uiapp.Application
items = UnwrapElement(IN[0])
version = app.VersionNumber
elementlist = list()
curvelist = list()

for item in items:
	doc = item.Document
	calculator = SpatialElementGeometryCalculator(doc)
	options = Autodesk.Revit.DB.SpatialElementBoundaryOptions()
	# get boundary location from area computation settings
	boundloc = Autodesk.Revit.DB.AreaVolumeSettings.GetAreaVolumeSettings(doc).GetSpatialElementBoundaryLocation(SpatialElementType.Room)
	options.SpatialElementBoundaryLocation = boundloc
	#method #1 - get boundary segments
	blist = list()
	clist = list()
	try:
		for boundarylist in item.GetBoundarySegments(options):
			for boundary in boundarylist:
				blist.append(doc.GetElement(boundary.ElementId))
				if version > 2016:
					clist.append(boundary.GetCurve().ToProtoType())
				else:
					clist.append(boundary.Curve.ToProtoType())
	except:
		pass
	#method #2 - spatial element geometry calculator
	try:
		results = calculator.CalculateSpatialElementGeometry(item)
		for face in results.GetGeometry().Faces:
			for bface in results.GetBoundaryFaceInfo(face):
				blist.append(doc.GetElement(bface.SpatialBoundaryElement.HostElementId))
	except:
		pass	
	# write results to list
	elementlist.append(blist)
	curvelist.append(clist)
OUT = (elementlist,curvelist)
# ----------------------------------------
code_block_2 = CodeBlock { 1; }
lunchbox_area_element_collector = Custom[LunchBox Area Element Collector](Toggle=code_block_2)  # Collects rooms from the Revit document
code_block_3 = CodeBlock(A=lunchbox_area_element_collector.Boundaries) { A; }

# group: GET THE BOUNDARY LINES END POINTS AND COPY THE FIRST POINT TO THE END OF THE LIST. (NEEDED FOR THE CREATE BOUND METHOD)
flatten = Flatten(code_block_3@L3)
endPoint = Curve.EndPoint(flatten)
python_script_2 = Python(IN[0]=endPoint)
# ---------- python_script_2.python (8 lines) ----------
list = IN[0]

for l in list:
	l.append(l[0])



OUT = list
# ----------------------------------------

code_block_4 = CodeBlock { "Area Loading Value"; }
getParameterAsProjectUnits = Custom[GetParameterAsProjectUnits](Elements=lunchbox_area_element_collector.Element, ParameterName=code_block_4)  # Returns the parameter value in the same unit type as the project settings
convert_between_units = DynamoConvert(getParameterAsProjectUnits, conversionMetric=Length, conversionFrom=Feet, conversionTo=Meters)
code_block_5 = CodeBlock(a=convert_between_units) { a*100; }

# group: CREATE A NOMINAL AREA LOAD
code_block_6 = CodeBlock { 0.003281; }
scale = Geometry.Scale(geometry=python_script_2, amount=code_block_6)
byCoordinates = Point.ByCoordinates(z=code_block_5)
element_types = ElementTypes("AreaLoadType")
all_elements_of_type = ElementsOfType(element_types)
firstItem = List.FirstItem(all_elements_of_type)
assign_area_load_python_script = Python(IN[0]=scale, IN[1]=byCoordinates, IN[2]=firstItem)
# ---------- assign_area_load_python_script.python (60 lines) ----------
import clr
clr.AddReference('ProtoGeometry')
from Autodesk.DesignScript.Geometry import *
#Import ToDSType(bool) extension method
clr.AddReference('RevitNodes')
import Revit
clr.ImportExtensions(Revit.GeometryConversion)
#Import DocumentManager and TransactionManager
clr.AddReference('RevitServices')
import RevitServices
from RevitServices.Persistence import DocumentManager
from RevitServices.Transactions import TransactionManager
from System.Collections.Generic import *
#import RevitAPI
clr.AddReference('RevitAPI')
import Autodesk
from Autodesk.Revit.DB import *
from Autodesk.Revit.DB.Structure import *
from System.Collections.Generic import *

doc = DocumentManager.Instance.CurrentDBDocument

#The inputs to this node will be stored as a list in the IN variables.
#Host=UnwrapElement(IN[0])

pts = UnwrapElement(IN[0])
F=IN[1]
loadtype=UnwrapElement(IN[2])

TransactionManager.Instance.EnsureInTransaction(doc)

#Profile Loop Container
pl = []

#create filled region
for j in range(0,len(pts)):
	outerProfileLoop = CurveLoop()
	pl.Add([outerProfileLoop])
	for i in range(0,len(pts[j])-1):
		outerProfileLoop.Append(Autodesk.Revit.DB.Line.CreateBound(XYZ(pts[j][i].X,pts[j][i].Y,pts[j][i].Z),XYZ(pts[j][i+1].X,pts[j][i+1].Y,pts[j][i+1].Z)))


loads=[]

for i in range(0,len(pl)):
	a= AreaLoad.Create(doc,pl[i],F[i].ToXyz(False),loadtype)	
	loads.append(a)


"""
for p in pl:
	a= AreaLoad.Create(doc,p,F,loadtype)	
	loads.append(a)
"""
#End Transaction

TransactionManager.Instance.TransactionTaskDone()

#Assign your output to the OUT variable.
OUT = loads
# ----------------------------------------

code_block_7 = CodeBlock { "Description"; }
setParameterByName = Element.SetParameterByName(element=assign_area_load_python_script, parameterName=code_block_7, value=lunchbox_area_element_collector.Name)
