# Dynamo graph Create_Hosted_Area_Loads09.dyn (Dynamo 1.3.0.875)

boolean = BoolSelector(true)
lunchbox_area_element_collector = Custom[LunchBox Area Element Collector](Toggle=boolean)  # Collects rooms from the Revit document
code_block = CodeBlock(A=lunchbox_area_element_collector.Boundaries) { A; }
code_block_2 = CodeBlock { 0; }

# group: THESE ARE THE DL, SDL AND LL PARAMETERS
code_block_3 = CodeBlock { {"DL","SDL","LL"}; }

# group: FROM MEPOVER
getParameterAsProjectUnits = Custom[GetParameterAsProjectUnits](Elements=lunchbox_area_element_collector.Element, ParameterName=code_block_3)  # Returns the parameter value in the same unit type as the project settings

# group: OPTION 1 - SELECT LINKED ROOMS
get_loaded_rvt_links = Custom[Get Loaded RVT Links]()
code_block_4 = CodeBlock(A=get_loaded_rvt_links.loaded_Link_Docs) { A[0]; }
categories = Categories("Rooms")
get_all_elements_from_linked = Custom[Get All Elements From Linked Model](LinkDoc=code_block_4, Category=categories)  # This node is based on code posted by Julien Benoit. Big thanks to Julien for sharing his work. This node will retrieve all elements of a given category from a given linked model.

code_block_5 = CodeBlock { "Level"; }
getParameterValueByName = Element.GetParameterValueByName(element=get_all_elements_from_linked, parameterName=code_block_5)
code_block_6 = CodeBlock { "01"; }
contains = String.Contains(str=getParameterValueByName, searchFor=code_block_6)
filterByBoolMask = List.FilterByBoolMask(list=get_all_elements_from_linked, mask=contains)

# group: EXTRACT THE ROOM CENTER BOUNDARIES, KEEP ONLY THE OUTER LINES (AT INDEX 0) AND GROUP THEM
centerBoundary = Room.CenterBoundary(filterByBoolMask.in)
code_block_7 = CodeBlock { 0; }
getItemAtIndex = List.GetItemAtIndex(list=centerBoundary, index=code_block_7, lacing=Longest)
group_curves = Custom[Group Curves](Curves=getItemAtIndex, lacing=Longest)  # This node will take any input of flat list of curves and group them into sublists containing "joinable" curves that is continous curves. They might form closed curves or open curves. Use PolyCurve.ByJoinedCurves to convert output groups of curves into single PolyCurves

levels = Levels("ROOM PLAN - LEVEL 00")
plane = Custom[Level.Plane](level=levels)  # Retrieves the plane of a given level
byPlane = SketchPlane.ByPlane(plane)
get_revit_activeview = Custom[Get Revit ActiveView]()  # Active View
fromCurve = Custom[AreaSeparator.FromCurve](curve=group_curves, sketchPlane=byPlane, areaPlanView=get_revit_activeview)  # Creates area separation lines from geometry curves.
select_model_element = DSModelElementSelection()  # 1 picked in the model
python_script = Python(IN[0]=select_model_element)
# ---------- python_script.python (51 lines) ----------
#Copyright(c) 2014, Nathan Miller
# The Proving Ground, http://theprovingground.org

import clr

# Import RevitAPI
clr.AddReference("RevitAPI")
import Autodesk
from Autodesk.Revit.DB import *

# Import DocumentManager and TransactionManager
clr.AddReference("RevitServices")
import RevitServices
from RevitServices.Persistence import DocumentManager
from RevitServices.Transactions import TransactionManager

# Import ToDSType(bool) extension method
clr.AddReference("RevitNodes")
import Revit
clr.ImportExtensions(Revit.Elements)
clr.ImportExtensions(Revit.GeometryConversion)

import clr
clr.AddReference('ProtoGeometry')
from Autodesk.DesignScript.Geometry import *

#The input to this node will be stored in the IN[0] variable.

doc =  DocumentManager.Instance.CurrentDBDocument
app =  DocumentManager.Instance.CurrentUIApplication.Application

room = UnwrapElement(IN[0])

boundaries = []


boptions = Autodesk.Revit.DB.SpatialElementBoundaryOptions()
boundsegs = room.GetBoundarySegments(boptions)
boundcurves = []


for bound in boundsegs:
	crvs = []
	boundcurves.append(crvs)
	for seg in bound:
		crv = seg.GetCurve()
		crvs.append(Revit.GeometryConversion.RevitToProtoCurve.ToProtoType( crv, True ))
  	
        
#Assign your output to the OUT variable
OUT = boundcurves
# ----------------------------------------
code_block_8 = CodeBlock { a; }  # unwired: a
code_block_9 = CodeBlock(a=select_model_element) { {a}; }
python_script_2 = Python()  # unwired: IN[0]
# ---------- python_script_2.python (110 lines) ----------
#Copyright(c) 2014, Nathan Miller
# The Proving Ground, http://theprovingground.org

import clr

# Import RevitAPI
clr.AddReference("RevitAPI")
import Autodesk
from Autodesk.Revit.DB import *

# Import DocumentManager and TransactionManager
clr.AddReference("RevitServices")
import RevitServices
from RevitServices.Persistence import DocumentManager
from RevitServices.Transactions import TransactionManager

# Import ToDSType(bool) extension method
clr.AddReference("RevitNodes")
import Revit
clr.ImportExtensions(Revit.Elements)
clr.ImportExtensions(Revit.GeometryConversion)

import clr
clr.AddReference('ProtoGeometry')
from Autodesk.DesignScript.Geometry import *

#The input to this node will be stored in the IN[0] variable.

doc =  DocumentManager.Instance.CurrentDBDocument
app =  DocumentManager.Instance.CurrentUIApplication.Application

toggle = IN[0]

output = []
rooms = []
names = []
numbers = []
areas = []
levels = []
boundaries = []
locations = []
areaschemes = []
elementids = []
uniqueids = []

if toggle == True:

	collector = FilteredElementCollector(doc)
	collector.OfCategory(BuiltInCategory.OST_Areas)
 
	famtypeitr = collector.GetElementIdIterator()
	famtypeitr.Reset()


	for item in famtypeitr:
		famtypeID = item
		faminst = doc.GetElement(famtypeID)
    
		#print faminst
		if faminst.Area > 0:
			room = faminst
			for p in room.Parameters:
				if p.Definition.Name == 'Name':		
					roomname = p.AsString()
				if p.Definition.Name == 'Level':			
					level = p.AsValueString()
					if (level is None):
						level = p.AsString()

			number = faminst.Number
			area = faminst.Area
			location = faminst.Location.Point.ToPoint()
			areascheme = faminst.AreaScheme.Name
			elementid = faminst.Id.ToString()
			uniqueid = faminst.UniqueId
    	
			boptions = Autodesk.Revit.DB.SpatialElementBoundaryOptions()
			boundsegs = room.GetBoundarySegments(boptions)
			boundcurves = []
			for bound in boundsegs:
				crvs = []
				for seg in bound:
					crv = seg.GetCurve()
					crvs.append(Revit.GeometryConversion.RevitToProtoCurve.ToProtoType( crv, True ))
				boundcurves.append(crvs)
    	
			rooms.append(room)
			names.append(roomname)
			numbers.append(number)
			areas.append(area)
			levels.append(level)
			boundaries.append(boundcurves)
			areaschemes.append(areascheme)
			locations.append(location)
			elementids.append(elementid)
			uniqueids.append(uniqueid)
        
	output.append(rooms)
	output.append(names)
	output.append(numbers)
	output.append(areas)
	output.append(levels)
	output.append(locations)
	output.append(boundaries)
	output.append(areaschemes)
	output.append(elementids)
	output.append(uniqueids)
        
#Assign your output to the OUT variable
OUT = output
# ----------------------------------------
code_block_10 = CodeBlock { {-1,-2,-3}; }
convert_between_units = DynamoConvert(code_block_10, conversionMetric=Length, conversionFrom=Feet, conversionTo=Meters)
code_block_11 = CodeBlock(a=convert_between_units) { a*1000; }
code_block_12 = CodeBlock { a[0]; }  # unwired: a
select_model_elements = DSModelElementsSelection()  # 2 picked in the model
python_script_3 = Python(IN[0]=boolean, IN[1]=select_model_elements)
# ---------- python_script_3.python (111 lines) ----------
#Copyright(c) 2014, Nathan Miller
# The Proving Ground, http://theprovingground.org

import clr

# Import RevitAPI
clr.AddReference("RevitAPI")
import Autodesk
from Autodesk.Revit.DB import *

# Import DocumentManager and TransactionManager
clr.AddReference("RevitServices")
import RevitServices
from RevitServices.Persistence import DocumentManager
from RevitServices.Transactions import TransactionManager

# Import ToDSType(bool) extension method
clr.AddReference("RevitNodes")
import Revit
clr.ImportExtensions(Revit.Elements)
clr.ImportExtensions(Revit.GeometryConversion)

import clr
clr.AddReference('ProtoGeometry')
from Autodesk.DesignScript.Geometry import *

#The input to this node will be stored in the IN[0] variable.

doc =  DocumentManager.Instance.CurrentDBDocument
app =  DocumentManager.Instance.CurrentUIApplication.Application

toggle = IN[0]

output = []
rooms = []
names = []
numbers = []
areas = []
levels = []
boundaries = []
locations = []
areaschemes = []
elementids = []
uniqueids = []

if toggle == True:

	collector = FilteredElementCollector(doc)
	collector.OfCategory(BuiltInCategory.OST_Areas)
 
	#famtypeitr = collector.GetElementIdIterator()
	#famtypeitr.Reset()
	famtypeitr = UnwrapElement(IN[1])

	for item in famtypeitr:
		#famtypeID = item
		#faminst = doc.GetElement(famtypeID)
		faminst = item
    
		#print faminst
		if faminst.Area > 0:
			room = faminst
			for p in room.Parameters:
				if p.Definition.Name == 'Name':		
					roomname = p.AsString()
				if p.Definition.Name == 'Level':			
					level = p.AsValueString()
					if (level is None):
						level = p.AsString()

			number = faminst.Number
			area = faminst.Area
			location = faminst.Location.Point.ToPoint()
			areascheme = faminst.AreaScheme.Name
			elementid = faminst.Id.ToString()
			uniqueid = faminst.UniqueId
    	
			boptions = Autodesk.Revit.DB.SpatialElementBoundaryOptions()
			boundsegs = room.GetBoundarySegments(boptions)
			boundcurves = []
			for bound in boundsegs:
				crvs = []
				for seg in bound:
					crv = seg.GetCurve()
					crvs.append(Revit.GeometryConversion.RevitToProtoCurve.ToProtoType( crv, True ))
				boundcurves.append(crvs)
    	
			rooms.append(room)
			names.append(roomname)
			numbers.append(number)
			areas.append(area)
			levels.append(level)
			boundaries.append(boundcurves)
			areaschemes.append(areascheme)
			locations.append(location)
			elementids.append(elementid)
			uniqueids.append(uniqueid)
        
	#output.append(rooms)
	output.append(names)
	#output.append(numbers)
	#output.append(areas)
	#output.append(levels)
	#output.append(locations)
	output.append(boundaries)
	#output.append(areaschemes)
	#output.append(elementids)
	#output.append(uniqueids)
        
#Assign your output to the OUT variable
OUT = output
# ----------------------------------------
code_block_13 = CodeBlock(a=python_script_3) { a[1]; }

# group: GET THE BOUNDARY LINES END POINTS AND COPY THE FIRST POINT TO THE END OF THE LIST. (NEEDED FOR THE CREATE BOUND METHOD)
flatten = Flatten(code_block@L3)
endPoint = Curve.EndPoint(code_block_13)
python_script_4 = Python(IN[0]=endPoint)
# ---------- python_script_4.python (9 lines) ----------
lista = IN[0]
newLista = lista

for i in range(0,len(lista)):
	for j in range(0,len(lista[i])):
		newLista[i][j].append(lista[i][j][0])
		
#Assign your output to the OUT variable.
OUT = newLista
# ----------------------------------------

# group: CREATE A AREA LOADS
element_types = ElementTypes("AreaLoadType")
all_elements_of_type = ElementsOfType(element_types)
assign_area_load_python_script = Python()  # unwired: IN[0], IN[1], IN[2]
# ---------- assign_area_load_python_script.python (61 lines) ----------
import clr
clr.AddReference('ProtoGeometry')
from Autodesk.DesignScript.Geometry import *
#Import ToDSType(bool) extension method
clr.AddReference('RevitNodes')
import Revit
clr.ImportExtensions(Revit.GeometryConversion)
#Import DocumentManager and TransactionManager
clr.AddReference('RevitServices')
import RevitServices
from RevitServices.Persistence import DocumentManager
from RevitServices.Transactions import TransactionManager
from System.Collections.Generic import *
#import RevitAPI
clr.AddReference('RevitAPI')
import Autodesk
from Autodesk.Revit.DB import *
from Autodesk.Revit.DB.Structure import *
from System.Collections.Generic import *

doc = DocumentManager.Instance.CurrentDBDocument

#The inputs to this node will be stored as a list in the IN variables.
#Host=UnwrapElement(IN[0])

pts = UnwrapElement(IN[0])
F=IN[1]
loadtype=UnwrapElement(IN[2])

TransactionManager.Instance.EnsureInTransaction(doc)

#Profile Loop Container
pl = []

if len(pts)>1:
	#create filled region
	for j in range(0,len(pts[0])):
		outerProfileLoop = CurveLoop()
		pl.Add([outerProfileLoop])
		for i in range(0,len(pts[0][j])-1):
			outerProfileLoop.Append(Autodesk.Revit.DB.Line.CreateBound(XYZ(pts[0][j][i].X,pts[0][j][i].Y,pts[0][j][i].Z),XYZ(pts[0][j][i+1].X,pts[0][j][i+1].Y,pts[0][j][i+1].Z)))
else:
	for j in range(0,len(pts[0])):
		outerProfileLoop = CurveLoop()
		pl.Add([outerProfileLoop])
		for i in range(0,len(pts[0][j])-1):
			outerProfileLoop.Append(Autodesk.Revit.DB.Line.CreateBound(XYZ(pts[0][j][i].X,pts[0][j][i].Y,pts[0][j][i].Z),XYZ(pts[0][j][i+1].X,pts[0][j][i+1].Y,pts[0][j][i+1].Z)))

loads=[]
	
for j in range(0,len(loadtype)):
	listLoad = []
	loads.append(listLoad)
	for i in range(0,len(pl)):
		a= AreaLoad.Create(doc,pl[i],F[j][i].ToXyz(False),loadtype[j])	
		listLoad.append(a)
			
TransactionManager.Instance.TransactionTaskDone()

#Assign your output to the OUT variable.
OUT = loads
# ----------------------------------------
byCoordinates = Point.ByCoordinates(z=code_block_11)
code_block_14 = CodeBlock { 0.003281; }
scale = Geometry.Scale(geometry=python_script_4, amount=code_block_14)

name = Element.Name(all_elements_of_type)

# group: ASSIGN LOAD TYPE (DL,SDL,LL) AND DESCRIPTION
code_block_15 = CodeBlock { "Load Case"; }
categories_2 = Categories("LoadCases")
all_elements_of_category = ElementsOfCategory(categories_2)
code_block_16 = CodeBlock(a=all_elements_of_category) { {a[0], a[5], a[1]}; }
setParameterByName = Element.SetParameterByName(element=assign_area_load_python_script, parameterName=code_block_15, value=code_block_16)
transpose = List.Transpose(assign_area_load_python_script)
code_block_17 = CodeBlock { "Description"; }
setParameterByName_2 = Element.SetParameterByName(element=transpose, parameterName=code_block_17, value=lunchbox_area_element_collector.Name)

name_2 = Element.Name(all_elements_of_category)
python_script_5 = Python(IN[2]=byCoordinates, IN[3]=all_elements_of_type)  # unwired: IN[0], IN[1]
# ---------- python_script_5.python (69 lines) ----------
import clr
clr.AddReference('ProtoGeometry')
from Autodesk.DesignScript.Geometry import *
#Import ToDSType(bool) extension method
clr.AddReference('RevitNodes')
import Revit
clr.ImportExtensions(Revit.GeometryConversion)
#Import DocumentManager and TransactionManager
clr.AddReference('RevitServices')
import RevitServices
from RevitServices.Persistence import DocumentManager
from RevitServices.Transactions import TransactionManager
from System.Collections.Generic import *
#import RevitAPI
clr.AddReference('RevitAPI')
import Autodesk
from Autodesk.Revit.DB import *
from Autodesk.Revit.DB.Structure import *
from System.Collections.Generic import *

doc = DocumentManager.Instance.CurrentDBDocument

doc = DocumentManager.Instance.CurrentDBDocument
uiapp = DocumentManager.Instance.CurrentUIApplication
app = uiapp.Application


regions = []
activeViewId = doc.ActiveView.Id;

TransactionManager.Instance.EnsureInTransaction(doc)

pts = UnwrapElement(IN[0])
innerPts = UnwrapElement(IN[1])
F=IN[2]
loadtype=UnwrapElement(IN[3])


profileLoops = []

pl = []

profileLoops.Add(pl)

#create filled region
for j in range(0,len(pts)):
		outerProfileLoop = CurveLoop()
		pl.Add(outerProfileLoop)
		for i in range(0,len(pts[j])-1):
			outerProfileLoop.Append(Autodesk.Revit.DB.Line.CreateBound(XYZ(pts[j][i].X,pts[j][i].Y,pts[j][i].Z),XYZ(pts[j][i+1].X,pts[j][i+1].Y,pts[j][i+1].Z)))
			
			
for j in range(0,len(innerPts)):
	innerProfileLoop = CurveLoop()
	pl.Add(innerProfileLoop)
	for i in range(0,len(innerPts[j])-1):
		innerProfileLoop.Append(Autodesk.Revit.DB.Line.CreateBound(XYZ(innerPts[j][i].X,innerPts[j][i].Y,innerPts[j][i].Z),XYZ(innerPts[j][i+1].X,innerPts[j][i+1].Y,innerPts[j][i+1].Z)))


loads=[]

for i in range(0,len(loadtype)):
		a= AreaLoad.Create(doc,profileLoops[0],F[i].ToXyz(False),loadtype[i])	
		loads.append(a)
	
TransactionManager.Instance.TransactionTaskDone()

#Assign your outputs to the OUT variable
OUT = loads
# ----------------------------------------
python_script_6 = Python(IN[0]=scale)
# ---------- python_script_6.python (21 lines) ----------
import clr
clr.AddReference('ProtoGeometry')
from Autodesk.DesignScript.Geometry import *
#The inputs to this node will be stored as a list in the IN variables.

lista = IN[0]

oP = []
iP = []

for i in range(0,len(lista)):
		if len(lista[i])>1:
			oP.append(lista[i][0])
			for j in range(1,len(lista[i])):
				iP.append(lista[i][j])
		else:
			oP.append(lista[i][0])


#Assign your output to the OUT variable.
OUT = oP,iP
# ----------------------------------------
code_block_18 = CodeBlock(a=python_script_6) { a[0]; }
python_script_7 = Python(IN[0]=code_block_18)
# ---------- python_script_7.python (10 lines) ----------
import clr
clr.AddReference('ProtoGeometry')
from Autodesk.DesignScript.Geometry import *
#The inputs to this node will be stored as a list in the IN variables.
dataEnteringNode = IN

pts = UnwrapElement(IN[0])

#Assign your output to the OUT variable.
OUT = len(pts)
# ----------------------------------------
code_block_19 = CodeBlock(load=byCoordinates, type=all_elements_of_type) { load; type; }
python_script_8 = Python(IN[0]=scale, IN[1]=code_block_19.load, IN[2]=code_block_19.type)
# ---------- python_script_8.python (93 lines) ----------
import clr
clr.AddReference('ProtoGeometry')
from Autodesk.DesignScript.Geometry import *
#Import ToDSType(bool) extension method
clr.AddReference('RevitNodes')
import Revit
clr.ImportExtensions(Revit.GeometryConversion)
#Import DocumentManager and TransactionManager
clr.AddReference('RevitServices')
import RevitServices
from RevitServices.Persistence import DocumentManager
from RevitServices.Transactions import TransactionManager
from System.Collections.Generic import *
#import RevitAPI
clr.AddReference('RevitAPI')
import Autodesk
from Autodesk.Revit.DB import *
from Autodesk.Revit.DB.Structure import *
from System.Collections.Generic import *


doc = DocumentManager.Instance.CurrentDBDocument
uiapp = DocumentManager.Instance.CurrentUIApplication
app = uiapp.Application


lista = IN[0]

profileLoops = []
pl = []

pl.Add(profileLoops)

for l in lista:
	if len(l)>1:
		oP = l[0]
		iP = l[1]
		outerProfileLoop = CurveLoop()
		innerProfileLoop = CurveLoop()
		loop = [outerProfileLoop,innerProfileLoop]
		profileLoops.Add(loop)
		for i in range(0,len(oP)-1):
			outerProfileLoop.Append(Autodesk.Revit.DB.Line.CreateBound(XYZ(oP[i].X,oP[i].Y,oP[i].Z),XYZ(oP[i+1].X,oP[i+1].Y,oP[i+1].Z)))
		for i in range(0,len(iP)-1):
			innerProfileLoop.Append(Autodesk.Revit.DB.Line.CreateBound(XYZ(iP[i].X,iP[i].Y,iP[i].Z),XYZ(iP[i+1].X,iP[i+1].Y,iP[i+1].Z)))
	else:
		oP = l[0]
		outerProfileLoop = CurveLoop()
		profileLoops.Add(outerProfileLoop)
		for i in range(0,len(oP)-1):
			outerProfileLoop.Append(Autodesk.Revit.DB.Line.CreateBound(XYZ(oP[i].X,oP[i].Y,oP[i].Z),XYZ(oP[i+1].X,oP[i+1].Y,oP[i+1].Z)))
	

F=IN[1]
loadtype=UnwrapElement(IN[2])

"""
TransactionManager.Instance.EnsureInTransaction(doc)




profileLoops = []

pl = []

profileLoops.Add(pl)

#create filled region
for j in range(0,len(pts)):
		outerProfileLoop = CurveLoop()
		pl.Add(outerProfileLoop)
		for i in range(0,len(pts[j])-1):
			outerProfileLoop.Append(Autodesk.Revit.DB.Line.CreateBound(XYZ(pts[j][i].X,pts[j][i].Y,pts[j][i].Z),XYZ(pts[j][i+1].X,pts[j][i+1].Y,pts[j][i+1].Z)))
			
			
for j in range(0,len(innerPts)):
	innerProfileLoop = CurveLoop()
	pl.Add(innerProfileLoop)
	for i in range(0,len(innerPts[j])-1):
		innerProfileLoop.Append(Autodesk.Revit.DB.Line.CreateBound(XYZ(innerPts[j][i].X,innerPts[j][i].Y,innerPts[j][i].Z),XYZ(innerPts[j][i+1].X,innerPts[j][i+1].Y,innerPts[j][i+1].Z)))


loads=[]

for i in range(0,len(loadtype)):
		a= AreaLoad.Create(doc,profileLoops[0],F[i].ToXyz(False),loadtype[i])	
		loads.append(a)
	
TransactionManager.Instance.TransactionTaskDone()
"""
#Assign your outputs to the OUT variable
OUT = profileLoops
# ----------------------------------------
code_block_20 = CodeBlock { "a"; }
python_script_9 = Python(IN[0]=scale)
# ---------- python_script_9.python (15 lines) ----------
import clr
clr.AddReference('ProtoGeometry')
from Autodesk.DesignScript.Geometry import *
#The inputs to this node will be stored as a list in the IN variables.

lista = IN[0]
ot = []
nl = []
for l in lista:
	if len(l)>1:
		ot.append("vero")
	else:
		ot.append("falso")
#Assign your output to the OUT variable.
OUT = ot,nl
# ----------------------------------------
