# Dynamo graph Create_Hosted_Area_Loads13.dyn (Dynamo 1.3.0.875)

boolean = BoolSelector(true)

# group: from Lunchbox
lunchbox_area_element_collector = Custom[LunchBox Area Element Collector](Toggle=boolean)  # Collects rooms from the Revit document

# group: GET THE BOUNDARY LINES END POINTS AND COPY THE FIRST POINT TO THE END OF THE LIST. (NEEDED FOR THE CREATE BOUND METHOD)
endPoint = Curve.EndPoint(lunchbox_area_element_collector.Boundaries)
python_script = Python(IN[0]=endPoint)
# ---------- python_script.python (9 lines) ----------
lista = IN[0]
newLista = lista

for i in range(0,len(lista)):
	for j in range(0,len(lista[i])):
		newLista[i][j].append(lista[i][j][0])
		
#Assign your output to the OUT variable.
OUT = newLista
# ----------------------------------------

# group: THESE ARE THE DL, SDL AND LL PARAMETERS
code_block = CodeBlock { {"DL","SDL","LL"}; }

# group: from MEPOVER
getParameterAsProjectUnits = Custom[GetParameterAsProjectUnits](Elements=lunchbox_area_element_collector.Element, ParameterName=code_block)  # Returns the parameter value in the same unit type as the project settings

convert_between_units = DynamoConvert(getParameterAsProjectUnits, conversionMetric=Length, conversionFrom=Feet, conversionTo=Meters)
code_block_2 = CodeBlock(a=convert_between_units) { a*1000; }

# group: CREATE A AREA LOADS
element_types = ElementTypes("AreaLoadType")
all_elements_of_type = ElementsOfType(element_types)
code_block_3 = CodeBlock { 0.003281; }
scale = Geometry.Scale(geometry=python_script, amount=code_block_3)
byCoordinates = Point.ByCoordinates(z=code_block_2)

name = Element.Name(all_elements_of_type)
python_script_2 = Python(IN[0]=scale, IN[1]=byCoordinates, IN[2]=all_elements_of_type)
# ---------- python_script_2.python (74 lines) ----------
import clr
clr.AddReference('ProtoGeometry')
from Autodesk.DesignScript.Geometry import *
#Import ToDSType(bool) extension method
clr.AddReference('RevitNodes')
import Revit
clr.ImportExtensions(Revit.GeometryConversion)
#Import DocumentManager and TransactionManager
clr.AddReference('RevitServices')
import RevitServices
from RevitServices.Persistence import DocumentManager
from RevitServices.Transactions import TransactionManager
from System.Collections.Generic import *
#import RevitAPI
clr.AddReference('RevitAPI')
import Autodesk
from Autodesk.Revit.DB import *
from Autodesk.Revit.DB.Structure import *
from System.Collections.Generic import *


doc = DocumentManager.Instance.CurrentDBDocument
uiapp = DocumentManager.Instance.CurrentUIApplication
app = uiapp.Application


lista = IN[0]

profileLoops = []


for l in lista:
	if len(l)>1:
		oP = l[0]
		iP = l[1:]
		outerProfileLoop = CurveLoop()
		ip = []
		loops = [outerProfileLoop]
		profileLoops.Add(loops)	
		for i in range(0,len(oP)-1):
			outerProfileLoop.Append(Autodesk.Revit.DB.Line.CreateBound(XYZ(oP[i].X,oP[i].Y,oP[i].Z),XYZ(oP[i+1].X,oP[i+1].Y,oP[i+1].Z)))
		for j in range(0,len(iP)):
			innerProfileLoop = CurveLoop()
			loops.append(innerProfileLoop)
			for i in range(0,len(iP[j])-1):
				innerProfileLoop.Append(Autodesk.Revit.DB.Line.CreateBound(XYZ(iP[j][i].X,iP[j][i].Y,iP[j][i].Z),XYZ(iP[j][i+1].X,iP[j][i+1].Y,iP[j][i+1].Z)))					
	else:
		oP = l[0]
		outerProfileLoop = CurveLoop()
		profileLoops.Add([outerProfileLoop])
		for i in range(0,len(oP)-1):
			outerProfileLoop.Append(Autodesk.Revit.DB.Line.CreateBound(XYZ(oP[i].X,oP[i].Y,oP[i].Z),XYZ(oP[i+1].X,oP[i+1].Y,oP[i+1].Z)))
	

F=IN[1]
loadtype=UnwrapElement(IN[2])


TransactionManager.Instance.EnsureInTransaction(doc)

loads=[]


for j in range(0,len(loadtype)):
	listLoad = []
	loads.append(listLoad)
	for i in range(0,len(profileLoops)):
		listLoad.append(AreaLoad.Create(doc,profileLoops[i],F[j][i].ToXyz(False),loadtype[j]))


TransactionManager.Instance.TransactionTaskDone()

#Assign your outputs to the OUT variable
OUT = loads
# ----------------------------------------

# group: ASSIGN LOAD TYPE (DL,SDL,LL) AND DESCRIPTION
code_block_4 = CodeBlock { "Load Case"; }
categories = Categories("LoadCases")
all_elements_of_category = ElementsOfCategory(categories)
code_block_5 = CodeBlock(a=all_elements_of_category) { {a[0], a[5], a[1]}; }
setParameterByName = Element.SetParameterByName(element=python_script_2, parameterName=code_block_4, value=code_block_5)
transpose = List.Transpose(python_script_2)
code_block_6 = CodeBlock { "Description"; }
setParameterByName_2 = Element.SetParameterByName(element=transpose, parameterName=code_block_6, value=lunchbox_area_element_collector.Name)

name_2 = Element.Name(all_elements_of_category)

# group: OPTION 1 - SELECT LINKED ROOMS
get_loaded_rvt_links = Custom[Get Loaded RVT Links]()
code_block_7 = CodeBlock(A=get_loaded_rvt_links.loaded_Link_Docs) { A[0]; }
categories_2 = Categories("Rooms")
get_all_elements_from_linked = Custom[Get All Elements From Linked Model](LinkDoc=code_block_7, Category=categories_2)  # This node is based on code posted by Julien Benoit. Big thanks to Julien for sharing his work. This node will retrieve all elements of a given category from a given linked model.

code_block_8 = CodeBlock { "Level"; }
getParameterValueByName = Element.GetParameterValueByName(element=get_all_elements_from_linked, parameterName=code_block_8)
code_block_9 = CodeBlock { "01"; }
contains = String.Contains(str=getParameterValueByName, searchFor=code_block_9)
filterByBoolMask = List.FilterByBoolMask(list=get_all_elements_from_linked, mask=contains)

# group: EXTRACT THE ROOM CENTER BOUNDARIES, KEEP ONLY THE OUTER LINES (AT INDEX 0) AND GROUP THEM
centerBoundary = Room.CenterBoundary(filterByBoolMask.in)
code_block_10 = CodeBlock { 0; }
getItemAtIndex = List.GetItemAtIndex(list=centerBoundary, index=code_block_10, lacing=Longest)
group_curves = Custom[Group Curves](Curves=getItemAtIndex, lacing=Longest)  # This node will take any input of flat list of curves and group them into sublists containing "joinable" curves that is continous curves. They might form closed curves or open curves. Use PolyCurve.ByJoinedCurves to convert output groups of curves into single PolyCurves

levels = Levels("ROOM PLAN - LEVEL 00")
plane = Custom[Level.Plane](level=levels)  # Retrieves the plane of a given level
byPlane = SketchPlane.ByPlane(plane)
get_revit_activeview = Custom[Get Revit ActiveView]()  # Active View
fromCurve = Custom[AreaSeparator.FromCurve](curve=group_curves, sketchPlane=byPlane, areaPlanView=get_revit_activeview)  # Creates area separation lines from geometry curves.
python_script_3 = Python()  # unwired: IN[0], IN[1]
# ---------- python_script_3.python (46 lines) ----------
import clr
clr.AddReference('ProtoGeometry')
from Autodesk.DesignScript.Geometry import *
clr.AddReference('RevitAPI')
from Autodesk.Revit.DB import *

clr.AddReference("RevitServices")
import RevitServices
from RevitServices.Persistence import DocumentManager
doc = DocumentManager.Instance.CurrentDBDocument
#The inputs to this node will be stored as a list in the IN variables.
if isinstance(IN[0], list):
	element = UnwrapElement(IN[0])
else:
	element = [UnwrapElement(IN[0])]
name = IN[1]
listout = []

def checkParameter(param):
	for p in param:
		internal = p.Definition
		if internal.BuiltInParameter != BuiltInParameter.INVALID:
			return p
	return param[0]

for e in element:
	param = e.GetParameters(name)
	if len(param) == 0:
		listout.append(None)
	else:
		p = checkParameter(param)
		if p.StorageType == StorageType.String:
			listout.append(p.AsString())
		elif p.StorageType == StorageType.ElementId:
			elem = doc.GetElement(p.AsElementId())
			listout.append(elem)
		elif p.StorageType == StorageType.Double:
			ProjectUnits = p.DisplayUnitType
			newval = UnitUtils.ConvertFromInternalUnits(p.AsDouble(),ProjectUnits)
			listout.append(newval)
		else:
			listout.append(p.AsInteger())
	

#Assign your output to the OUT variable.
OUT = listout
# ----------------------------------------
python_script_4 = Python()  # unwired: IN[0]
# ---------- python_script_4.python (110 lines) ----------
#Copyright(c) 2014, Nathan Miller
# The Proving Ground, http://theprovingground.org

import clr

# Import RevitAPI
clr.AddReference("RevitAPI")
import Autodesk
from Autodesk.Revit.DB import *

# Import DocumentManager and TransactionManager
clr.AddReference("RevitServices")
import RevitServices
from RevitServices.Persistence import DocumentManager
from RevitServices.Transactions import TransactionManager

# Import ToDSType(bool) extension method
clr.AddReference("RevitNodes")
import Revit
clr.ImportExtensions(Revit.Elements)
clr.ImportExtensions(Revit.GeometryConversion)

import clr
clr.AddReference('ProtoGeometry')
from Autodesk.DesignScript.Geometry import *

#The input to this node will be stored in the IN[0] variable.

doc =  DocumentManager.Instance.CurrentDBDocument
app =  DocumentManager.Instance.CurrentUIApplication.Application

toggle = IN[0]

output = []
rooms = []
names = []
numbers = []
areas = []
levels = []
boundaries = []
locations = []
areaschemes = []
elementids = []
uniqueids = []

if toggle == True:

	collector = FilteredElementCollector(doc)
	collector.OfCategory(BuiltInCategory.OST_Areas)
 
	famtypeitr = collector.GetElementIdIterator()
	famtypeitr.Reset()


	for item in famtypeitr:
		famtypeID = item
		faminst = doc.GetElement(famtypeID)
    
		#print faminst
		if faminst.Area > 0:
			room = faminst
			for p in room.Parameters:
				if p.Definition.Name == 'Name':		
					roomname = p.AsString()
				if p.Definition.Name == 'Level':			
					level = p.AsValueString()
					if (level is None):
						level = p.AsString()

			number = faminst.Number
			area = faminst.Area
			location = faminst.Location.Point.ToPoint()
			areascheme = faminst.AreaScheme.Name
			elementid = faminst.Id.ToString()
			uniqueid = faminst.UniqueId
    	
			boptions = Autodesk.Revit.DB.SpatialElementBoundaryOptions()
			boundsegs = room.GetBoundarySegments(boptions)
			boundcurves = []
			for bound in boundsegs:
				crvs = []
				for seg in bound:
					crv = seg.GetCurve()
					crvs.append(Revit.GeometryConversion.RevitToProtoCurve.ToProtoType( crv, True ))
				boundcurves.append(crvs)
    	
			rooms.append(room)
			names.append(roomname)
			numbers.append(number)
			areas.append(area)
			levels.append(level)
			boundaries.append(boundcurves)
			areaschemes.append(areascheme)
			locations.append(location)
			elementids.append(elementid)
			uniqueids.append(uniqueid)
        
	output.append(rooms)
	output.append(names)
	output.append(numbers)
	output.append(areas)
	output.append(levels)
	output.append(locations)
	output.append(boundaries)
	output.append(areaschemes)
	output.append(elementids)
	output.append(uniqueids)
        
#Assign your output to the OUT variable
OUT = output
# ----------------------------------------
install_bakery = Custom[Install Bakery]()
