# Dynamo graph attachElements.dyn (Dynamo 2.2.0.4667)

select_model_elements = DSModelElementsSelection()  # 2 picked in the model
python_script = Python(IN[0]=select_model_elements)
# ---------- python_script.python (35 lines) ----------
import clr

clr.AddReference('RevitAPI')
from Autodesk.Revit.DB import *
from Autodesk.Revit.DB.Structure import *

clr.AddReference('RevitAPIUI')
from Autodesk.Revit.UI import *

clr.AddReference('System')
from System.Collections.Generic import List

clr.AddReference('RevitNodes')
import Revit
clr.ImportExtensions(Revit.GeometryConversion)
clr.ImportExtensions(Revit.Elements)

clr.AddReference('RevitServices')
import RevitServices
from RevitServices.Persistence import DocumentManager
from RevitServices.Transactions import TransactionManager

doc = DocumentManager.Instance.CurrentDBDocument
uidoc=DocumentManager.Instance.CurrentUIApplication.ActiveUIDocument

#Preparing input from dynamo to revit
elements = UnwrapElement(IN[0])
locs = []

for e in elements:
	bboxCenter = e.get_BoundingBox(doc.ActiveView).Min
	loc = e.Location.Point
	locs.append(XYZ(loc.X, loc.Y, bboxCenter.Z).ToPoint())

OUT = locs
# ----------------------------------------
ZAxis = Vector.ZAxis()
views = Views("{3D - giobro}")
code_block = CodeBlock { "Structural Framing"; }
python_script_2 = Python(IN[0]=code_block)
# ---------- python_script_2.python (37 lines) ----------
import clr

import System

clr.AddReference('RevitAPI')
from Autodesk.Revit.DB import *
from Autodesk.Revit.DB.Structure import *

clr.AddReference('RevitAPIUI')
from Autodesk.Revit.UI import *

clr.AddReference('System')
from System.Collections.Generic import List

clr.AddReference('RevitNodes')
import Revit
clr.ImportExtensions(Revit.GeometryConversion)
clr.ImportExtensions(Revit.Elements)

clr.AddReference('RevitServices')
import RevitServices
from RevitServices.Persistence import DocumentManager
from RevitServices.Transactions import TransactionManager

doc = DocumentManager.Instance.CurrentDBDocument
uidoc=DocumentManager.Instance.CurrentUIApplication.ActiveUIDocument

#Preparing input from dynamo to revit
cat = IN[0]

#bics = [b for b in System.Enum.GetValues(BuiltInCategory)]

catId = [c.Id for c in doc.Settings.Categories if c.Name == cat]

#bic = System.Enum.ToObject(BuiltInCategory, catId)

OUT = catId[0]
# ----------------------------------------
python_script_3 = Python(IN[0]=python_script, IN[1]=ZAxis, IN[2]=views, IN[3]=python_script_2)
# ---------- python_script_3.python (42 lines) ----------
import clr

clr.AddReference('RevitAPI')
from Autodesk.Revit.DB import *
from Autodesk.Revit.DB.Structure import *

clr.AddReference('RevitAPIUI')
from Autodesk.Revit.UI import *

clr.AddReference('System')
from System.Collections.Generic import List

clr.AddReference('RevitNodes')
import Revit
clr.ImportExtensions(Revit.GeometryConversion)
clr.ImportExtensions(Revit.Elements)

clr.AddReference('RevitServices')
import RevitServices
from RevitServices.Persistence import DocumentManager
from RevitServices.Transactions import TransactionManager

doc = DocumentManager.Instance.CurrentDBDocument
uidoc=DocumentManager.Instance.CurrentUIApplication.ActiveUIDocument

#Preparing input from dynamo to revit
centers = UnwrapElement(IN[0])
rayDirection = XYZ(0,0,1)
view3D = UnwrapElement(IN[2])
cat = UnwrapElement(IN[3])

#filter = ElementCategoryFilter(BuiltInCategory.OST_StructuralFraming);
filter = ElementCategoryFilter(cat);
refIntersector = ReferenceIntersector(filter, FindReferenceTarget.Element, view3D)
elements = []

for c in centers:
	referenceWithContext = refIntersector.FindNearest(c.ToRevitType(), rayDirection);
	reference = referenceWithContext.GetReference();
	elements.append(doc.GetElement(reference))

OUT = elements
# ----------------------------------------
python_script_4 = Python(IN[0]=select_model_elements, IN[1]=python_script_3)
# ---------- python_script_4.python (43 lines) ----------
import clr

clr.AddReference('RevitAPI')
from Autodesk.Revit.DB import *
from Autodesk.Revit.DB.Structure import *

clr.AddReference('RevitAPIUI')
from Autodesk.Revit.UI import *

clr.AddReference('System')
from System.Collections.Generic import List

clr.AddReference('RevitNodes')
import Revit
clr.ImportExtensions(Revit.GeometryConversion)
clr.ImportExtensions(Revit.Elements)

clr.AddReference('RevitServices')
import RevitServices
from RevitServices.Persistence import DocumentManager
from RevitServices.Transactions import TransactionManager

doc = DocumentManager.Instance.CurrentDBDocument
uidoc=DocumentManager.Instance.CurrentUIApplication.ActiveUIDocument

#Preparing input from dynamo to revit
columns = UnwrapElement(IN[0])
targets = UnwrapElement(IN[1])

#Do some action in a Transaction
TransactionManager.Instance.EnsureInTransaction(doc)

for c,t in zip(columns, targets):
	try:
		ColumnAttachment.AddColumnAttachment(doc, c, t,1,ColumnAttachmentCutStyle.CutColumn,ColumnAttachmentJustification.Minimum,0)
#		ColumnAttachment.RemoveColumnAttachment(c, t)
		OUT = True
	except:
		import traceback
		OUT = traceback.format_exc()
	

TransactionManager.Instance.TransactionTaskDone()
# ----------------------------------------
code_block_2 = CodeBlock { "Floors"; }
