# Dynamo graph audit.dyn (Dynamo 2.0.1.4955)

python_script = Python()
# ---------- python_script.python (56 lines) ----------
import clr

clr.AddReference('RevitAPI')
from Autodesk.Revit.DB import *
from Autodesk.Revit.DB.Structure import *

clr.AddReference('RevitAPIUI')
from Autodesk.Revit.UI import *

clr.AddReference('System')
from System.Collections.Generic import List

clr.AddReference('RevitNodes')
import Revit
clr.ImportExtensions(Revit.GeometryConversion)
clr.ImportExtensions(Revit.Elements)

clr.AddReference('RevitServices')
import RevitServices
from RevitServices.Persistence import DocumentManager
from RevitServices.Transactions import TransactionManager

doc = DocumentManager.Instance.CurrentDBDocument
uidoc=DocumentManager.Instance.CurrentUIApplication.ActiveUIDocument


collector = FilteredElementCollector( doc ).WhereElementIsNotElementType()

cat = []
catNames = []

for c in collector:
	if (None != c.Category and c.Category.HasMaterialQuantities):
		cat.append(c)
		catNames.append(c.Name)

unique = list(set(catNames))

indexes = []

f = lambda my_list, value:filter(lambda x: my_list[x] == value, range(len(my_list)))

for x in unique:
	indexes.append(f(catNames, x))

result = []


for i in indexes:
	sub = []
	result.append(sub)	
	for j in i:
		sub.append(cat[j])


OUT = result, unique, [len(r) for r in result]
# ----------------------------------------
code_block = CodeBlock { 0; }
watch = Custom[Springs.Watch+](input=python_script, addIndexes=code_block)  # This node that serializes the input information and presents it in a resizable text window.
