# Dynamo graph beamToColumn.dyn (Dynamo 0.8.2.2392)

select_model_elements = DSModelElementsSelection()
location = StructuralFraming.Location(select_model_elements)
select_model_element = DSModelElementSelection()
type = Custom[Element.Type](element=select_model_element)  # Gets the family type of a given element (if applicable).
location_2 = Custom[Element.Location](element=select_model_elements)  # Returns the location of an element as an XYZ (or if it's line-based the start and end point of the line), along with some booleans to help filtering the results. Use this for some element types (e.g. walls or lines) that do not work with the built-in Get Family Instance Location node.
startPoint = Curve.StartPoint(location_2.curves)
endPoint = Curve.EndPoint(location_2.curves)
code_block = CodeBlock(a=startPoint, b=endPoint) { a.X; a.Y; b.Z; }
byCoordinates = Point.ByCoordinates(x=code_block.out0, y=code_block.out1, z=code_block.out2)
byStartPointEndPoint = Line.ByStartPointEndPoint(startPoint=startPoint, endPoint=byCoordinates)
levels = Levels("F01 - FIRST FLOOR")
structural_column_types = StructuralColumnTypes("PFC150x75x18")
columnByCurve = StructuralFraming.ColumnByCurve(byStartPointEndPoint, levels, structural_column_types)
code_block_2 = CodeBlock { 1; }
delete_elements = Custom[Delete Elements](Delete=code_block_2)  # This node will delete elements from Revit project.
code_block_3 = CodeBlock { "Comments"; }
code_block_4 = CodeBlock { "Walkway F01"; }
setParameterByName = Element.SetParameterByName(parameterName=code_block_3, value=code_block_4)
