# Dynamo graph bs1192SheetCreator.dyn (Dynamo 1.3.1.1736)

code_block_type = CodeBlock { "GA"; }
family_types = FamilyTypes("Arup_A1v_Frame_BS1192_v1:A1v")
code_block_drg_number = CodeBlock { 1..10; }
string_from_object = FromObject(code_block_drg_number)
code_block = CodeBlock { 6; }
code_block_2 = CodeBlock { "0"; }
padLeft = String.PadLeft(string_from_object, code_block, code_block_2)
code_block_3 = CodeBlock(a=string_from_object) { "SheetName"+a; }
code_block_4 = CodeBlock { 0; }
createEmptySheet = Custom[Tool.CreateEmptySheet](Type_TitleBlock=family_types, List=padLeft, List_2=code_block_3, Refresh=code_block_4)  # Add the amount of sheets from titleblock type. numbers and names are set from lists
code_block_5 = CodeBlock { {"Project","Originator","Zones and Assets","Levels and Locations","ARUP_BDR_ROLE"}; }
code_block_project = CodeBlock { "123456"; }
code_block_originator = CodeBlock { "ARP"; }
code_block_zone_assets = CodeBlock { "XX"; }
code_block_level_locations = CodeBlock { "00"; }
code_block_role = CodeBlock { "STRUCTURE"; }
join = List.Join(code_block_project, code_block_originator, code_block_zone_assets, code_block_level_locations, code_block_role)
setParameterByName = Element.SetParameterByName(element=createEmptySheet@@L1, parameterName=code_block_5, value=join)
