# Dynamo graph changeColumnLocation_v08.dyn (Dynamo 0.8.2.2392)

select_model_elements = DSModelElementsSelection()  # 2 picked in the model
python_script = Python(IN[0]=select_model_elements)
# ---------- python_script.python (30 lines) ----------
import clr
clr.AddReference('RevitAPI')
from Autodesk.Revit.DB import *

clr.AddReference("RevitNodes")
import Revit
clr.ImportExtensions(Revit.GeometryConversion)

clr.AddReference('ProtoGeometry')
from Autodesk.DesignScript.Geometry import *

items = UnwrapElement(IN[0])

lines = []

for item in items:
	lines.append(item.Location.Curve.ToProtoType())

Pts = []


for line in lines:
	pt = []
	pt.append(Curve.PointAtParameter(line,0))
	stPt = Curve.PointAtParameter(line,0)
	endPt = Curve.PointAtParameter(line,1)
	pt.append(Point.ByCoordinates(stPt.X,stPt.Y,endPt.Z))
	Pts.append(pt)

OUT = Pts
# ----------------------------------------
python_script_2 = Python(IN[0]=select_model_elements, IN[1]=python_script)
# ---------- python_script_2.python (42 lines) ----------
import clr

clr.AddReference("RevitServices")
import RevitServices
from RevitServices.Persistence import DocumentManager
from RevitServices.Transactions import TransactionManager
doc = DocumentManager.Instance.CurrentDBDocument

clr.AddReference("RevitAPI")
import Autodesk
from Autodesk.Revit.DB import *

clr.AddReference("RevitNodes")
import Revit
clr.ImportExtensions(Revit.Elements)
clr.ImportExtensions(Revit.GeometryConversion)

clr.AddReference("System")
from System.Collections.Generic import List

beamElements = UnwrapElement(IN[0])
pts = UnwrapElement(IN[1])

beamLocations = []

for beam in beamElements:
	beamLocations.append(beam.Location)

newBeamLine = []

TransactionManager.Instance.EnsureInTransaction(doc)

for i in range(0,len(beamLocations)):
	newBeamLine = Line.CreateBound(pts[i][0].ToXyz(), pts[i][1].ToXyz())
	#Change the beam location line to a new line:
	beamLocations[i].Curve = newBeamLine;

            

TransactionManager.Instance.TransactionTaskDone()

OUT = beamElements
# ----------------------------------------
select_model_element = DSModelElementSelection()  # 1 picked in the model
code_block = CodeBlock { {a}; }
code_block_2 = CodeBlock { "Column Style"; }
code_block_3 = CodeBlock { 0; }
setParameterByName = Element.SetParameterByName(parameterName=code_block_2, value=code_block_3)
code_block_4 = CodeBlock { {a}; }
python_script_3 = Python(IN[0]=code_block_4)  # same code as python_script
python_script_4 = Python(IN[0]=code_block_4, IN[1]=python_script_3)  # same code as python_script_2
code_block_5 = CodeBlock { 255; }
byARGB = Color.ByARGB(r=code_block_5)
overrideColorInView = Element.OverrideColorInView(color=byARGB)
code_block_6 = CodeBlock { "Column Style"; }
getParameterValueByName = Element.GetParameterValueByName(parameterName=code_block_6)
code_block_7 = CodeBlock(a=getParameterValueByName) { a>0; }
filterByBoolMask = List.FilterByBoolMask(list=select_model_elements, mask=code_block_7)
