# Dynamo graph changeFamilyTypeInViews.dyn (Dynamo 2.0.1.5055)

select_model_elements = DSModelElementsSelection()  # 12 picked in the model

# group: Select all the tags in the views
python_script = Python(IN[0]=select_model_elements)
# ---------- python_script.python (21 lines) ----------
#Copyright (c) mostafa el ayoubi ,  2017
#Data-Shapes www.data-shapes.net , elayoubi.mostafa@gmail.com

import clr
clr.AddReference('RevitAPI')
from Autodesk.Revit.DB import*
clr.AddReference('RevitServices')
from RevitServices.Persistence import DocumentManager

doc = DocumentManager.Instance.CurrentDBDocument

if isinstance(IN[0],list):
	views = UnwrapElement(IN[0])
else:
	views = [UnwrapElement(IN[0])]

elements = [FilteredElementCollector(doc,v.ViewId).ToElements() for v in views]



OUT = [[i for i in items if i.Category != None and i.Category.Name == "Structural Framing Tags"] for items in elements]
# ----------------------------------------

flatten = List.Flatten(list=python_script)
code_block = CodeBlock { "Arup_St Framing ID_TMK Tag"; }
byName = FamilyType.ByName(name=code_block)
code_block_2 = CodeBlock(elements=flatten, newType=byName) { Element.SetParameterByName(elements, "Type", newType); }
