# Dynamo graph clash01.dyn (Dynamo 1.3.2.2480)

# group: Select Beams
select_model_elements = DSModelElementsSelection()  # 3 picked in the model

geometry = Element.Geometry(select_model_elements)

# group: FROM LINK MODEL
select_model_element = DSModelElementSelection()  # 1 picked in the model
categories = Categories("CableTray")
ofCategory = Revit.LinkElement.OfCategory(select_model_element, categories)

intersectsElement = Revit.Element.IntersectsElement(select_model_elements, ofCategory)
location = Revit.LinkElement.Location(intersectsElement)
intersect = Geometry.Intersect(geometry=geometry@L1, other=location, lacing=Longest)
flatten = Flatten(intersect@L3)
code_block = CodeBlock { 0.5; }
pointAtParameter = Curve.PointAtParameter(curve=flatten, param=code_block)
flatten_2 = Flatten(location)
family_types = FamilyTypes("Arup_OpeningAdjustableCube:OpeningAdjustableCube")
boundingBox = Element.BoundingBox(select_model_elements)
boundingBox_2 = Revit.LinkElement.BoundingBox(intersectsElement)
intersection = BoundingBox.Intersection(boundingBox, boundingBox_2)
properties = Custom[BoundingBox.Properties](boundingBox=intersection)  # Retrieves the centroid, width, depth and height of a given bounding box

# group: Level
levels = Levels("LEVEL 1")

byPointAndLevel = FamilyInstance.ByPointAndLevel(familyType=family_types, point=properties.Centroid, level=levels)
code_block_2 = CodeBlock { "z"; }

# group: TOLERANCES
code_block_3 = CodeBlock { 100; }
code_block_4 = CodeBlock { 100; }

code_block_5 = CodeBlock(Heights=properties.Height, Tolerance=code_block_3) { Heights+Tolerance; }
setParameterByName = Element.SetParameterByName(element=byPointAndLevel, parameterName=code_block_2, value=code_block_5, lacing=Longest)
code_block_6 = CodeBlock { "y"; }
code_block_7 = CodeBlock(Depths=properties.Depth, Tolerance=code_block_4) { Depths+Tolerance; }
setParameterByName_2 = Element.SetParameterByName(element=byPointAndLevel, parameterName=code_block_6, value=code_block_7, lacing=Longest)
code_block_8 = CodeBlock { "x"; }
setParameterByName_3 = Element.SetParameterByName(element=byPointAndLevel, parameterName=code_block_8, value=properties.Width, lacing=Longest)
location_2 = StructuralFraming.Location(select_model_elements)
code_block_9 = CodeBlock { "z Offset Value"; }
getParameterValueByName = Element.GetParameterValueByName(element=select_model_elements, parameterName=code_block_9)
translate = Geometry.Translate(geometry=location_2, zTranslation=getParameterValueByName)
code_block_10 = CodeBlock { "Type"; }
getParameterValueByName_2 = Element.GetParameterValueByName(element=select_model_elements, parameterName=code_block_10)
code_block_11 = CodeBlock { "d"; }
getParameterValueByName_3 = Element.GetParameterValueByName(element=getParameterValueByName_2, parameterName=code_block_11)
code_block_12 = CodeBlock { -1; }
mul = getParameterValueByName_3 * code_block_12
translate_2 = Geometry.Translate(geometry=translate, zTranslation=mul)

# group: Check
byCurve = ModelCurve.ByCurve(translate_2)  # frozen

code_block_13 = CodeBlock { "Comments"; }
setParameterByName_4 = Element.SetParameterByName(element=byPointAndLevel, parameterName=code_block_13, lacing=Longest)  # unwired: value
flatten_3 = Flatten(byPointAndLevel)
endPoints = Geometry.Curves.EndPoints(translate)
create = List.Create(endPoints.out0, endPoints.out1)
transpose = List.Transpose(create)
toCuboid = BoundingBox.ToCuboid(intersection)
centroid = Solid.Centroid(toCuboid)

# group: Distance from ends
python_script = Python(IN[0]=transpose, IN[1]=centroid)
# ---------- python_script.python (25 lines) ----------
import clr
clr.AddReference('ProtoGeometry')
from Autodesk.DesignScript.Geometry import *
#The inputs to this node will be stored as a list in the IN variables.

import math

beamEnds = IN[0]
opCenter = IN[1]

distances = []


for i in range(0,len(beamEnds)):
	dist = []
	distances.append(dist)
	for j in range(0,len(opCenter[i])):
		sub_dist = []
		dist.append(sub_dist)
		for k in range(0,2):
			sub_dist.append(math.pow(math.pow(beamEnds[i][k].X - opCenter[i][j].X,2) + math.pow(beamEnds[i][k].Y - opCenter[i][j].Y,2), 0.5))
			#dist.append(math.pow(math.pow(beamEnds[i][1].X - opCenter[i][j].X,2) + math.pow(beamEnds[i][1].Y - opCenter[i][j].Y,2), 0.5))

#Assign your output to the OUT variable.
OUT = distances
# ----------------------------------------

code_block_14 = CodeBlock { {"Dimensions_Length_Cut","Dimensions_Length_Nodal"}; }
getParameterValueByName_4 = Element.GetParameterValueByName(element=select_model_elements, parameterName=code_block_14, lacing=CrossProduct)
python_script_2 = Python(IN[0]=getParameterValueByName_4)
# ---------- python_script_2.python (13 lines) ----------
import clr
clr.AddReference('ProtoGeometry')
from Autodesk.DesignScript.Geometry import *
#The inputs to this node will be stored as a list in the IN variables.
dist = IN[0]

trimLength = []

for i in range(0,len(dist)):
	trimLength.append(dist[i][1]-dist[i][0])

#Assign your output to the OUT variable.
OUT = trimLength
# ----------------------------------------
code_block_15 = CodeBlock(a=python_script_2) { a/2; }
sub = python_script - code_block_15
code_block_16 = CodeBlock(a=code_block_7) { a/2; }
sub_2 = sub - code_block_16
code_block_17 = CodeBlock(W2=code_block_7) { W2; }
gt = sub_2 > code_block_17

# group: Distance from Top Flange
distanceTo = Geometry.DistanceTo(geometry=translate, other=centroid, lacing=Longest)

code_block_18 = CodeBlock(beamDepth=getParameterValueByName_3) { (beamDepth-100)/2; }
gt_2 = distanceTo > code_block_18

# group: Distance from Bottom Flange
distanceTo_2 = Geometry.DistanceTo(geometry=translate_2, other=centroid, lacing=Longest)

code_block_19 = CodeBlock(beamDepth=getParameterValueByName_3) { (beamDepth-100)/2; }
gt_3 = distanceTo_2 > code_block_19
python_script_3 = Python(IN[0]=gt, IN[1]=gt_2, IN[2]=gt_3)
# ---------- python_script_3.python (20 lines) ----------
import clr
clr.AddReference('ProtoGeometry')
from Autodesk.DesignScript.Geometry import *
#The inputs to this node will be stored as a list in the IN variables.
listA = IN[0]
listB = IN[1]
listC = IN[2]


for i in range(0,len(listA)):
	for j in range(0,len(listA[i])):
		listA[i][j].append(listB[i][j])

for i in range(0,len(listA)):
	for j in range(0,len(listA[i])):
		listA[i][j].append(listC[i][j])


#Assign your output to the OUT variable.
OUT = listA
# ----------------------------------------
countFalse = CountFalse(python_script_3@L2)
code_block_20 = CodeBlock { 0; }
gt_4 = countFalse > code_block_20
filterByBoolMask = List.FilterByBoolMask(list=flatten_3, mask=gt_4)
red = Custom[Color.Red]()  # Returns the colour red.
overrideColorInView = Element.OverrideColorInView(element=filterByBoolMask.in, color=red)
