# Dynamo graph clash02.dyn (Dynamo 1.3.2.2480)

# group: Select Beams
select_model_elements = DSModelElementsSelection()  # 3 picked in the model

all_elements_in_active_view = ElementsInView()
type = Object.Type(all_elements_in_active_view)
code_block = CodeBlock { "Framing"; }
contains = String.Contains(str=type, searchFor=code_block)
filterByBoolMask = List.FilterByBoolMask(list=all_elements_in_active_view, mask=contains)
geometry = Element.Geometry(filterByBoolMask.in)

# group: FROM LINK MODEL
select_model_element = DSModelElementSelection()  # 1 picked in the model
categories = Categories("CableTray")
ofCategory = Revit.LinkElement.OfCategory(select_model_element, categories)

intersectsElement = Revit.Element.IntersectsElement(filterByBoolMask.in, ofCategory)
location = Revit.LinkElement.Location(intersectsElement)
intersect = Geometry.Intersect(geometry=geometry@L1, other=location, lacing=Longest)
flatten = Flatten(intersect@L3)
code_block_2 = CodeBlock { 0.5; }
pointAtParameter = Curve.PointAtParameter(curve=flatten, param=code_block_2)
flatten_2 = Flatten(location)

# group: Family Placeholder
family_types = FamilyTypes("Arup_OpeningAdjustableCube:OpeningAdjustableCube")

boundingBox = Element.BoundingBox(filterByBoolMask.in)
boundingBox_2 = Revit.LinkElement.BoundingBox(intersectsElement)
intersection = BoundingBox.Intersection(boundingBox, boundingBox_2)
properties = Custom[BoundingBox.Properties](boundingBox=intersection)  # Retrieves the centroid, width, depth and height of a given bounding box
byPoint = FamilyInstance.ByPoint(familyType=family_types, point=properties.Centroid)
code_block_3 = CodeBlock { "z"; }

# group: TOLERANCES
code_block_4 = CodeBlock { 100; }
code_block_5 = CodeBlock { 100; }

code_block_6 = CodeBlock(Heights=properties.Height, Tolerance=code_block_4) { Heights+Tolerance; }
setParameterByName = Element.SetParameterByName(element=byPoint, parameterName=code_block_3, value=code_block_6, lacing=Longest)
code_block_7 = CodeBlock { "y"; }
code_block_8 = CodeBlock(Depths=properties.Depth, Tolerance=code_block_5) { Depths+Tolerance; }
setParameterByName_2 = Element.SetParameterByName(element=byPoint, parameterName=code_block_7, value=code_block_8, lacing=Longest)
code_block_9 = CodeBlock { "x"; }
setParameterByName_3 = Element.SetParameterByName(element=byPoint, parameterName=code_block_9, value=properties.Width, lacing=Longest)
location_2 = StructuralFraming.Location(filterByBoolMask.in)
code_block_10 = CodeBlock { "z Offset Value"; }
getParameterValueByName = Element.GetParameterValueByName(element=filterByBoolMask.in, parameterName=code_block_10)
translate = Geometry.Translate(geometry=location_2, zTranslation=getParameterValueByName)
code_block_11 = CodeBlock { "Type"; }
getParameterValueByName_2 = Element.GetParameterValueByName(element=filterByBoolMask.in, parameterName=code_block_11)
code_block_12 = CodeBlock { "d"; }
getParameterValueByName_3 = Element.GetParameterValueByName(element=getParameterValueByName_2, parameterName=code_block_12)
code_block_13 = CodeBlock { -1; }
mul = getParameterValueByName_3 * code_block_13
translate_2 = Geometry.Translate(geometry=translate, zTranslation=mul)

# group: Check
byCurve = ModelCurve.ByCurve(translate_2)  # frozen

code_block_14 = CodeBlock { "Comments"; }
setParameterByName_4 = Element.SetParameterByName(element=byPoint, parameterName=code_block_14, lacing=Longest)  # unwired: value
toCuboid = BoundingBox.ToCuboid(intersection)
centroid = Solid.Centroid(toCuboid)

# group: Distance from Top Flange
distanceTo = Geometry.DistanceTo(geometry=translate, other=centroid, lacing=Longest)

code_block_15 = CodeBlock(a=code_block_6) { a/2; }
sub = distanceTo - code_block_15
code_block_16 = CodeBlock(beamDepth=getParameterValueByName_3) { (beamDepth)/4; }

# group: 0.25D?
gt = sub > code_block_16

filterByBoolMask_2 = List.FilterByBoolMask(list=byPoint, mask=gt)
red = Custom[Color.Red]()  # Returns the colour red.
overrideColorInView = Element.OverrideColorInView(element=filterByBoolMask_2.out, color=red)

# group: Distance from Bottom Flange
distanceTo_2 = Geometry.DistanceTo(geometry=translate_2, other=centroid, lacing=Longest)

code_block_17 = CodeBlock(a=code_block_6) { a/2; }
sub_2 = distanceTo_2 - code_block_17
code_block_18 = CodeBlock(beamDepth=getParameterValueByName_3) { (beamDepth)/4; }

# group: 0.25D min?
gt_2 = sub_2 > code_block_18

filterByBoolMask_3 = List.FilterByBoolMask(list=byPoint, mask=gt_2)
blue = Custom[Color.Blue]()  # Returns the colour blue.
overrideColorInView_2 = Element.OverrideColorInView(element=filterByBoolMask_3.out, color=blue)
endPoints = Geometry.Curves.EndPoints(translate)
create = List.Create(endPoints.out0, endPoints.out1)
transpose = List.Transpose(create)

# group: Distance from ends
python_script = Python(IN[0]=transpose, IN[1]=centroid)
# ---------- python_script.python (25 lines) ----------
import clr
clr.AddReference('ProtoGeometry')
from Autodesk.DesignScript.Geometry import *
#The inputs to this node will be stored as a list in the IN variables.

import math

beamEnds = IN[0]
opCenter = IN[1]

distances = []


for i in range(0,len(beamEnds)):
	dist = []
	distances.append(dist)
	for j in range(0,len(opCenter[i])):
		sub_dist = []
		dist.append(sub_dist)
		for k in range(0,2):
			sub_dist.append(math.pow(math.pow(beamEnds[i][k].X - opCenter[i][j].X,2) + math.pow(beamEnds[i][k].Y - opCenter[i][j].Y,2), 0.5))
			#dist.append(math.pow(math.pow(beamEnds[i][1].X - opCenter[i][j].X,2) + math.pow(beamEnds[i][1].Y - opCenter[i][j].Y,2), 0.5))

#Assign your output to the OUT variable.
OUT = distances
# ----------------------------------------

code_block_19 = CodeBlock { {"Dimensions_Length_Cut","Dimensions_Length_Nodal"}; }
getParameterValueByName_4 = Element.GetParameterValueByName(element=filterByBoolMask.in, parameterName=code_block_19, lacing=CrossProduct)

# group: LNodal-LCut
python_script_2 = Python(IN[0]=getParameterValueByName_4)
# ---------- python_script_2.python (13 lines) ----------
import clr
clr.AddReference('ProtoGeometry')
from Autodesk.DesignScript.Geometry import *
#The inputs to this node will be stored as a list in the IN variables.
dist = IN[0]

trimLength = []

for i in range(0,len(dist)):
	trimLength.append(dist[i][1]-dist[i][0])

#Assign your output to the OUT variable.
OUT = trimLength
# ----------------------------------------

code_block_20 = CodeBlock(a=python_script_2) { a/2; }
sub_3 = python_script - code_block_20
code_block_21 = CodeBlock(a=code_block_8) { a/2; }
sub_4 = sub_3 - code_block_21
code_block_22 = CodeBlock(W2=code_block_8) { W2; }

# group: >Opening Width?
gt_3 = sub_4 > code_block_22

python_script_3 = Python(IN[0]=gt_3)
# ---------- python_script_3.python (19 lines) ----------
import clr
clr.AddReference('ProtoGeometry')
from Autodesk.DesignScript.Geometry import *
#The inputs to this node will be stored as a list in the IN variables.
list = IN[0]

output= []

for i in range(0,len(list)):
	ot = []
	output.append(ot)
	for j in range(0,len(list[i])):
		if list[i][j][0] == True and list[i][j][1] == True:
			ot.append(True)
		else:
			ot.append(False)

#Assign your output to the OUT variable.
OUT = output
# ----------------------------------------
filterByBoolMask_4 = List.FilterByBoolMask(list=byPoint, mask=python_script_3)
teal = Custom[Color.Teal]()  # Returns the colour teal.
overrideColorInView_3 = Element.OverrideColorInView(element=filterByBoolMask_4.out, color=teal)
code_block_23 = CodeBlock(beamDepth=getParameterValueByName_3) { (beamDepth)*2; }

# group: >2xBeam Depth
gt_4 = sub_4 > code_block_23

python_script_4 = Python(IN[0]=gt_4)  # same code as python_script_3
filterByBoolMask_5 = List.FilterByBoolMask(list=byPoint, mask=python_script_4)
purple = Custom[Color.Purple]()  # Returns the colour purple.
overrideColorInView_4 = Element.OverrideColorInView(element=filterByBoolMask_5.out, color=purple)
code_block_24 = CodeBlock { a; }  # unwired: a
