# Dynamo graph clash05.dyn (Dynamo 1.3.2.2480)

select_model_elements = DSModelElementsSelection()
select_model_elements_2 = DSModelElementsSelection()
code_block = CodeBlock(a=select_model_elements, b=select_model_elements_2) { {a,b}; }
select_model_elements_3 = DSModelElementsSelection()
select_model_elements_4 = DSModelElementsSelection()
code_block_2 = CodeBlock(a=select_model_elements_3, b=select_model_elements_4) { {a,b}; }
python_script = Python(IN[0]=code_block, IN[1]=code_block_2)
# ---------- python_script.python (183 lines) ----------
import clr
clr.AddReference("ProtoGeometry")
from Autodesk.DesignScript.Geometry import *

LineBestFit = Line.ByBestFitThroughPoints

# Import RevitAPI
clr.AddReference("RevitAPI")
from Autodesk.Revit.DB import *
clr.AddReference("RevitAPIUI")
from Autodesk.Revit.UI import TaskDialog
# Import DocumentManager and TransactionManager
clr.AddReference("RevitServices")
from RevitServices.Persistence import DocumentManager
from RevitServices.Transactions import TransactionManager
# Import ToProtoType, ToRevitType geometry conversion extension methods
clr.AddReference("RevitNodes")
import Revit
clr.ImportExtensions(Revit.GeometryConversion)

import math

doc = DocumentManager.Instance.CurrentDBDocument
uiapp = DocumentManager.Instance.CurrentUIApplication
app = uiapp.Application


beam = UnwrapElement(IN[0])
duct = UnwrapElement(IN[1])
dynamoBeams = IN[0]


def GetElemType(e):
	try:
		elemType = doc.GetElement(e.GetTypeId())
		return elemType
	except:
		pass
		return None

def GetParamValue(eType, pName):
	paramValue = None
	for i in eType.Parameters:
		if i.Definition.Name == pName:
			paramValue = i.AsValueString()
			break
		else:
			continue
	return paramValue


def GetParam(element, name):
	p = element.get_Parameter(name)	
	if p.StorageType == StorageType.String:
		return p.AsString()
	elif p.StorageType == StorageType.ElementId:
		elem = doc.GetElement(p.AsElementId())
		return elem
	elif p.StorageType == StorageType.Double:
		ProjectUnits = p.DisplayUnitType
		newval = UnitUtils.ConvertFromInternalUnits(p.AsDouble(),ProjectUnits)
		return newval
	else:
		return p.AsInteger()

def GetEndPoints(beam):
	return [beam.Location.Curve.GetEndPoint(0).ToPoint(), beam.Location.Curve.GetEndPoint(1).ToPoint()]


def PointXYDistance(Pt0, Pt1):
	distance = math.pow((math.pow((Pt0.X-Pt1.X),2) + math.pow((Pt0.Y-Pt1.Y),2)),0.5)
	return round(distance,0)

def beamRealCurve(element):
	vertex = element.Geometry()[0].Vertices
	pGeom = []
	for v in vertex:
		pGeom.append(v.PointGeometry)
	crv = LineBestFit(pGeom)	
	return crv
	

values = []
checks = []

for i in range(0,len(beam)):
	val = []
	values.append(val)
	che = []
	checks.append(che)
	for j in range(0,len(duct[i])):
		# BEAM PARAMETERS
		
		zOffset = GetParam(beam[i], BuiltInParameter.Z_OFFSET_VALUE) # NEGATIVE VALUE!
		
		beamZTop = GetEndPoints(beam[i])[0].Z + zOffset
		
		#beamEndPoint = GetEndPoints(beam)[1] NOT ACCURATE!
		
		beamStPoint = beamRealCurve(dynamoBeams[i]).StartPoint
		beamEndPoint = beamRealCurve(dynamoBeams[i]).EndPoint
		
		#length = round(GetParam(beam, BuiltInParameter.INSTANCE_LENGTH_PARAM),0) NOT NEEDED ANYMORE!
		
		#cutLength = round(GetParam(beam, BuiltInParameter.STRUCTURAL_FRAME_CUT_LENGTH),0) NOT NEEDED ANYMORE!
		
		#remainLength = length - cutLength NOT NEEDED ANYMORE!
		
		beamDepth = int(GetParamValue(GetElemType(beam[i]), "d"))
		
		
		# DUCT PARAMETERS
		
		ductWidth = int(GetParamValue(duct[i][j], "y"))
		
		
		
		ductHeight = int(GetParamValue(duct[i][j], "z"))
		
		
		
		ductCentroid = duct[i][j].Location.Point.ToPoint()
		
		
		# CHECKS 
		
		# 1. BEAM START POINT TO OPENING EDGE DISTANCE
		
		beamStOpeningEdgeDist = PointXYDistance(ductCentroid, beamStPoint) - ductWidth/2
		
		val.append(beamStOpeningEdgeDist)
		
		beamEndOpeningEdgeDist = PointXYDistance(ductCentroid, beamEndPoint) - ductWidth/2
		
		val.append(beamEndOpeningEdgeDist)
		
		# 2. DISTANCE FROM FLANGES
		
		distTopFlange = round(beamZTop - ductCentroid.Z - ductHeight/2,0)
		
		val.append(distTopFlange)
		
		distBotFlange = round(beamDepth - ductHeight - distTopFlange,0)
		
		val.append(distBotFlange)
		
		val.append(ductWidth)
		
		val.append(ductHeight)
		
		# 3. CHECKS
		
		checkA = beamStOpeningEdgeDist > (2 * beamDepth or ductWidth)
		
		checkB = beamEndOpeningEdgeDist > (2 * beamDepth or ductWidth)
		
		checkC = distTopFlange > (0.25 * beamDepth)
		
		checkD = distBotFlange > (0.25 * beamDepth)
		
		checkE = ductWidth < beamDepth
		
		checkF = ductHeight < (0.5 * beamDepth)
		
		che.append(checkA)
		che.append(checkB)
		che.append(checkC)
		che.append(checkD)
		che.append(checkE)
		che.append(checkF)
		
		


#names = ["beamStOpeningEdgeDist", "beamEndOpeningEdgeDist", "distTopFlange", "distBotFlange", "ductWidth", "ductHeight"]
#values = [beamStOpeningEdgeDist, beamEndOpeningEdgeDist, distTopFlange, distBotFlange, ductWidth, ductHeight]
#checks = [checkA, checkB, checkC, checkD, checkE, checkF]

#dict = [names, values, checks]

#OUT = map(list, zip(*dict))

OUT = values, checks
# ----------------------------------------
code_block_3 = CodeBlock { 6; }
chop = List.Chop(list=python_script@L2, lengths=code_block_3, lacing=Longest)
select_model_elements_5 = DSModelElementsSelection()  # 1 picked in the model
select_model_elements_6 = DSModelElementsSelection()  # 3 picked in the model
duct_clash_check = Custom[Duct Clash Check](Beams=select_model_elements_5, Ducts=select_model_elements_6, lacing=Longest)  # Check Clash
code_block_4 = CodeBlock(a=select_model_elements_5) { {a}; }
code_block_5 = CodeBlock(b=select_model_elements_6) { {b}; }
python_script_2 = Python(IN[0]=code_block_4, IN[1]=code_block_5)
# ---------- python_script_2.python (114 lines) ----------
import clr
clr.AddReference("ProtoGeometry")
from Autodesk.DesignScript.Geometry import *

LineBestFit = Line.ByBestFitThroughPoints

# Import RevitAPI
clr.AddReference("RevitAPI")
from Autodesk.Revit.DB import *
clr.AddReference("RevitAPIUI")
from Autodesk.Revit.UI import TaskDialog
# Import DocumentManager and TransactionManager
clr.AddReference("RevitServices")
from RevitServices.Persistence import DocumentManager
from RevitServices.Transactions import TransactionManager
# Import ToProtoType, ToRevitType geometry conversion extension methods
clr.AddReference("RevitNodes")
import Revit
clr.ImportExtensions(Revit.GeometryConversion)

import math

doc = DocumentManager.Instance.CurrentDBDocument
uiapp = DocumentManager.Instance.CurrentUIApplication
app = uiapp.Application


beamList = UnwrapElement(IN[0])
ductList = UnwrapElement(IN[1])
dynamoBeams = IN[0]


def GetElemType(e):
	try:
		elemType = doc.GetElement(e.GetTypeId())
		return elemType
	except:
		pass
		return None

def GetParamValue(eType, pName):
	paramValue = None
	for i in eType.Parameters:
		if i.Definition.Name == pName:
			paramValue = i.AsValueString()
			break
		else:
			continue
	return paramValue


def GetParam(element, name):
	p = element.get_Parameter(name)	
	if p.StorageType == StorageType.String:
		return p.AsString()
	elif p.StorageType == StorageType.ElementId:
		elem = doc.GetElement(p.AsElementId())
		return elem
	elif p.StorageType == StorageType.Double:
		ProjectUnits = p.DisplayUnitType
		newval = UnitUtils.ConvertFromInternalUnits(p.AsDouble(),ProjectUnits)
		return newval
	else:
		return p.AsInteger()

def GetEndPoints(beam):
	return [beam.Location.Curve.GetEndPoint(0).ToPoint(), beam.Location.Curve.GetEndPoint(1).ToPoint()]


def PointXYDistance(Pt0, Pt1):
	distance = math.pow((math.pow((Pt0.X-Pt1.X),2) + math.pow((Pt0.Y-Pt1.Y),2)),0.5)
	return round(distance,0)

def beamRealCurve(element):
	vertex = element.Geometry()[0].Vertices
	pGeom = []
	for v in vertex:
		pGeom.append(v.PointGeometry)
	crv = LineBestFit(pGeom)	
	return crv
	

values = []
checks = []



class RectDuct:
	def __init__(self, Shape, Width, HostedBeam):
		self.Shape = "Rectangle"
		self.Width = Width
		self.HostedBeam = HostedBeam
	
	def printOut(self):
		return [self.Shape, self.Width, self.HostedBeam]
		

objDuct = []


for i in range(0,len(beamList)):
	for j in range(0,len(ductList[i])):
		if ductList[i][j].Name == "RectDuct":
			instance = RectDuct("Rectangle", GetParamValue(ductList[i][j], "y"), beamList[i].Id)
#			instance.Width = GetParamValue(ductList[i][j], "y")
			objDuct.append(instance)
		else:
			objDuct.append("another duct")


		


OUT = [d.printOut() for d in objDuct]
# ----------------------------------------
python_script_3 = Python(IN[0]=code_block_5)
# ---------- python_script_3.python (40 lines) ----------
import clr
clr.AddReference('ProtoGeometry')
from Autodesk.DesignScript.Geometry import *

clr.AddReference('RevitServices')
import RevitServices
from RevitServices.Persistence import DocumentManager
from RevitServices.Transactions import TransactionManager
from System.Collections.Generic import *

clr.AddReference('RevitNodes')
import Revit
clr.ImportExtensions(Revit.Elements)

clr.AddReference('RevitAPI')
import Autodesk
from Autodesk.Revit.DB import *
from Autodesk.Revit.DB.Electrical import *
from Autodesk.Revit.DB import MEPSystem

clr.AddReference('DSCoreNodes')
import DSCore
from DSCore.List import *

#The inputs to this node will be stored as a list in the IN variables.

input = UnwrapElement(IN[0])

listElectComponents = []


for i in range(0, len(input)):
	electComponents = List[ElementId]()
	listElectComponents.append(electComponents)
	for j in range (0,len(input[i])):
		electComponents.Add(input[i][j].Id)


#Assign your output to the OUT variable.
OUT = listElectComponents
# ----------------------------------------
type = Object.Type(python_script_3)
python_script_4 = Python(IN[0]=code_block_5)
# ---------- python_script_4.python (56 lines) ----------
import clr
clr.AddReference('ProtoGeometry')
from Autodesk.DesignScript.Geometry import *

clr.AddReference('RevitServices')
import RevitServices
from RevitServices.Persistence import DocumentManager
from RevitServices.Transactions import TransactionManager
from System.Collections.Generic import *

clr.AddReference('RevitNodes')
import Revit
clr.ImportExtensions(Revit.Elements)

clr.AddReference('RevitAPI')
import Autodesk
from Autodesk.Revit.DB import *
from Autodesk.Revit.DB.Electrical import *
from Autodesk.Revit.DB import MEPSystem

clr.AddReference('DSCoreNodes')
import DSCore
from DSCore.List import *

#The inputs to this node will be stored as a list in the IN variables.

input = UnwrapElement(IN[0])

list = []

class me():
	pass


class Rev():
    def __init__(self, initval=0, name='var'):
        self.val = initval
        self.name = name


io = me()

io.age = 34
io.name = "giovann"


tu = me()

tu.age = 45
tu.Name = "serg"

ei = Rev()


#Assign your output to the OUT variable.
OUT = io.name, tu.Name
# ----------------------------------------
python_script_5 = Python(IN[0]=code_block_5)
# ---------- python_script_5.python (37 lines) ----------
import clr
clr.AddReference('ProtoGeometry')
from Autodesk.DesignScript.Geometry import *
#The inputs to this node will be stored as a list in the IN variables.

list = IN[0]


class Shape:

    def __init__(self, x, y):
        self.x = x
        self.y = y
        self.description = "This shape has not been described yet"
        self.author = "Nobody has claimed to make this shape yet"

    def area(self):
        return self.x * self.y

    def perimeter(self):
        return 2 * self.x + 2 * self.y

    def describe(self, text):
        self.description = text

    def authorName(self, text):
        self.author = text

    def scaleSize(self, scale):
        self.x = self.x * scale
        self.y = self.y * scale


rect = Shape(10,45)

#Assign your output to the OUT variable.
OUT = rect
# ----------------------------------------
