# Dynamo graph classCheckDistance.dyn (Dynamo 2.0.1.4955)

select_model_element = DSModelElementSelection()  # 1 picked in the model
location = StructuralFraming.Location(structuralFraming=select_model_element)
vertical_grids = DSModelElementsSelection()  # 4 picked in the model
name = Element.Name(element=vertical_grids)
horizontal_grids = DSModelElementsSelection()  # 3 picked in the model
name_2 = Element.Name(element=horizontal_grids)
curve = Grid.Curve(grid=vertical_grids)
curve_2 = Grid.Curve(grid=horizontal_grids)
findIntersections = Geometry.Intersection.FindIntersections(geo=curve, others=curve_2)
flatten = List.Flatten(list=findIntersections)
python_script = Python(IN[0]=name, IN[1]=name_2, IN[2]=flatten)
# ---------- python_script.python (43 lines) ----------
import clr

clr.AddReference('ProtoGeometry')
from Autodesk.DesignScript.Geometry import Point

clr.AddReference('RevitAPI')
from Autodesk.Revit.DB import *
from Autodesk.Revit.DB.Structure import *

clr.AddReference('RevitAPIUI')
from Autodesk.Revit.UI import *

clr.AddReference('System')
from System.Collections.Generic import List

clr.AddReference('RevitNodes')
import Revit
clr.ImportExtensions(Revit.GeometryConversion)
clr.ImportExtensions(Revit.Elements)

clr.AddReference('RevitServices')
import RevitServices
from RevitServices.Persistence import DocumentManager
from RevitServices.Transactions import TransactionManager

class GridPoint:
	def __init__(self, point, name, vGrid, hGrid):
		self.pt = point
		self.name = name
		self.vG = vGrid
		self.hG = hGrid

list= []
for vGrid in IN[0]:
	for hGrid in IN[1]:
		instance = GridPoint(None, str(vGrid)+str(hGrid),vGrid, hGrid)
		list.append(instance)

for l,p in zip(list, IN[2]):
	l.pt = p


OUT = list
# ----------------------------------------
python_script_2 = Python(IN[0]=location, IN[1]=python_script)
# ---------- python_script_2.python (18 lines) ----------
import clr

clr.AddReference('ProtoGeometry')
from Autodesk.DesignScript.Geometry import Point


beamEnds = [IN[0].PointAtParameter(0),IN[0].PointAtParameter(1)]
gridObj = IN[1]

distances = []

for b in beamEnds:
	subList = []
	distances.append(subList)
	for g in gridObj:
		subList.append([b.DistanceTo(g.pt),g.name])
		    
OUT = [min(d) for d in distances]
# ----------------------------------------
XY = Plane.XY()
pullOntoPlane = Curve.PullOntoPlane(curve=location, plane=XY)
