# Dynamo graph cleanDWG.dyn (Dynamo 1.3.1.1736)

delete_elements = Custom[Delete Elements]()  # This node will delete elements from Revit project.; unwired: Elements, Delete
element_types = ElementTypes("ImportInstance")
all_elements_of_type = ElementsOfType(element_types)
watch = Watch(all_elements_of_type)
ownerView = Custom[Element.OwnerView](element=watch)  # Gets the owner view of a given Revit element (if possible)
code_block = CodeBlock(a=ownerView) { a[46]; }
name = Element.Name(code_block)
code_block_2 = CodeBlock { "Name"; }
getParameterValueByName = Element.GetParameterValueByName(element=watch, parameterName=code_block_2)
code_block_3 = CodeBlock { ".dwg"; }
contains = String.Contains(str=getParameterValueByName, searchFor=code_block_3)
filterByBoolMask = List.FilterByBoolMask(list=watch, mask=contains)
delete = Archilab.Grimshaw.Elements.Element.Delete()  # unwired: arg0
ownerView_2 = Custom[Element.OwnerView]()  # unwired: element
