# Dynamo graph createSheets.dyn (Dynamo 0.8.2.2392)

create_placeholder_sheet = Custom[Create Placeholder Sheet]()  # This node will create placeholder sheets from a sheet number/name.
code_block = CodeBlock { 1; }
python_script = Python(IN[2]=code_block)
# ---------- python_script.python (88 lines) ----------
#Copyright(c) 2015, Konrad Sobon
# @arch_laboratory, http://archi-lab.net

import clr
clr.AddReference('ProtoGeometry')
from Autodesk.DesignScript.Geometry import *

# Import ToDSType(bool) extension method
clr.AddReference("RevitNodes")
import Revit
clr.ImportExtensions(Revit.Elements)

# Import DocumentManager and TransactionManager
clr.AddReference("RevitServices")
import RevitServices
from RevitServices.Persistence import DocumentManager
from RevitServices.Transactions import TransactionManager

from System.Collections.Generic import *

# Import RevitAPI
clr.AddReference("RevitAPI")
import Autodesk
from Autodesk.Revit.DB import *

doc = DocumentManager.Instance.CurrentDBDocument
uiapp = DocumentManager.Instance.CurrentUIApplication
app = uiapp.Application

import sys
pyt_path = r'C:\Program Files (x86)\IronPython 2.7\Lib'
sys.path.append(pyt_path)

#The inputs to this node will be stored as a list in the IN variable.
dataEnteringNode = IN

sheetNumbers = IN[0]
sheetNames = IN[1]
runMe = IN[2]

if runMe:
	try:
		errorReport = None
		
		# Collect all sheets in the project
		existingSheets = FilteredElementCollector(doc).OfCategory(BuiltInCategory.OST_Sheets)
		projectSheetNum = []
		for i in existingSheets:
			eSheetNumber = i.get_Parameter(BuiltInParameter.SHEET_NUMBER).AsString()
			# Strip spaces from sheet number
			projectSheetNum.append("".join(eSheetNumber.split()))

		TransactionManager.Instance.EnsureInTransaction(doc)
		sheets = []
		for i, j in zip(sheetNames, sheetNumbers):
			if "".join(j.split()) in projectSheetNum:
				# only update params
				# get existing sheet
				index = projectSheetNum.index("".join(j.split()))
				sheet = list(existingSheets)[index]
				# update params
				sheetName = sheet.get_Parameter(BuiltInParameter.SHEET_NAME)
				sheetName.Set(i)
				sheets.append(sheet)
			else:
				# create new placeholder sheet and set params
				newSheet = ViewSheet.CreatePlaceholder(doc)
				#set sheet name param
				sheetName = newSheet.get_Parameter(BuiltInParameter.SHEET_NAME)
				sheetName.Set(i)
				#set sheet number param
				sheetNumber = newSheet.get_Parameter(BuiltInParameter.SHEET_NUMBER)
				sheetNumber.Set(j)
				sheets.append(newSheet)
				
		TransactionManager.Instance.TransactionTaskDone()
	except:
		# if error accurs anywhere in the process catch it
		import traceback
		errorReport = traceback.format_exc()
else:
	errorReport = "Set RunMe to True to create new Placeholder Sheets"
	
#Assign your output to the OUT variable
if errorReport == None:
	OUT = sheets
else:
	OUT = errorReport
# ----------------------------------------
byNumberAndName = Custom[PlaceholderSheet.ByNumberAndName]()  # Creates placeholder sheets
family_types = FamilyTypes("Title_Blocks_A0_Metric:Standard")
code_block_2 = CodeBlock(a=family_types) { {a}; }
python_script_2 = Python(IN[0]=code_block_2)
# ---------- python_script_2.python (17 lines) ----------
import clr
clr.AddReference('RevitAPI')
from Autodesk.Revit.DB import *

clr.AddReference("RevitNodes")
import Revit
clr.ImportExtensions(Revit.Elements)

items = UnwrapElement(IN[0])
elementlist = list()
unmatched = list()
for item in items:
	try:
		elementlist.append(item.Id)
	except:
		unmatched.append(item)
OUT = (elementlist, unmatched)
# ----------------------------------------
code_block_3 = CodeBlock(a=python_script_2) { a[0][0]; }
code_block_4 = CodeBlock { {"999900","999901"}; }
code_block_5 = CodeBlock { {"aaa","bbb"}; }
python_script_3 = Python(IN[0]=code_block_4, IN[1]=code_block_5)
# ---------- python_script_3.python (48 lines) ----------
#Copyright(c) 2014, Konrad Sobon
# @arch_laboratory, http://archi-lab.net

import clr
clr.AddReference('ProtoGeometry')
from Autodesk.DesignScript.Geometry import *

# Import DocumentManager and TransactionManager
clr.AddReference("RevitServices")
import RevitServices
from RevitServices.Persistence import DocumentManager
from RevitServices.Transactions import TransactionManager

# Import RevitAPI
clr.AddReference("RevitAPI")
import Autodesk
from Autodesk.Revit.DB import *

doc = DocumentManager.Instance.CurrentDBDocument
uiapp = DocumentManager.Instance.CurrentUIApplication
app = uiapp.Application

#The inputs to this node will be stored as a list in the IN variable.
dataEnteringNode = IN

excelSheetNumber = IN[0]
excelSheetName = IN[1]

#get all sheets in the project and their numbers
collector = FilteredElementCollector(doc)
sheets = collector.OfCategory(BuiltInCategory.OST_Sheets)
projectSheetNum = []
for i in sheets:
    bipNumber = BuiltInParameter.SHEET_NUMBER
    tempSheetNum = i.get_Parameter(bipNumber).AsString()
    projectSheetNum.append("".join(tempSheetNum.split()))
    
#compare excel sheets to project sheets and pass only new sheets
newNumber, newName = [], []
for i, j in zip(excelSheetNumber, excelSheetName):
    if "".join(i.split()) in projectSheetNum:
        continue
    else:
        newNumber.append(i)
        newName.append(j)

#Assign your output to the OUT variable
OUT = newNumber, newName
# ----------------------------------------
code_block_6 = CodeBlock { 0; }
getItemAtIndex = List.GetItemAtIndex(list=python_script_3, index=code_block_6, lacing=Longest)
code_block_7 = CodeBlock { 1; }
getItemAtIndex_2 = List.GetItemAtIndex(list=python_script_3, index=code_block_7, lacing=Longest)
python_script_4 = Python(IN[0]=code_block_3, IN[1]=getItemAtIndex, IN[2]=getItemAtIndex_2)
# ---------- python_script_4.python (58 lines) ----------
#Copyright(c) 2014, Konrad Sobon
# @arch_laboratory, http://archi-lab.net

import clr
clr.AddReference('ProtoGeometry')
from Autodesk.DesignScript.Geometry import *

# Import ToDSType(bool) extension method
clr.AddReference("RevitNodes")
import Revit
clr.ImportExtensions(Revit.Elements)

# Import DocumentManager and TransactionManager
clr.AddReference("RevitServices")
import RevitServices
from RevitServices.Persistence import DocumentManager
from RevitServices.Transactions import TransactionManager

from System.Collections.Generic import *

# Import RevitAPI
clr.AddReference("RevitAPI")
import Autodesk
from Autodesk.Revit.DB import *

doc = DocumentManager.Instance.CurrentDBDocument
uiapp = DocumentManager.Instance.CurrentUIApplication
app = uiapp.Application

#The inputs to this node will be stored as a list in the IN variable.
dataEnteringNode = IN

titleBlockTypeId = IN[0]
sheetNumbers = IN[1]
sheetNames = IN[2]

# "Start" the transaction
TransactionManager.Instance.EnsureInTransaction(doc)

sheets = []
for i, j in zip(sheetNames, sheetNumbers):
	#create new sheet
	newSheet = ViewSheet.Create(doc, titleBlockTypeId)
	#set sheet name param
	bipName = BuiltInParameter.SHEET_NAME
	sheetName = newSheet.get_Parameter(bipName)
	sheetName.Set(i)
	#set sheet number param
	bipNumber = BuiltInParameter.SHEET_NUMBER
	sheetNumber = newSheet.get_Parameter(bipNumber)
	sheetNumber.Set(j)
	#collect all newly created sheets
	sheets.append(newSheet)
# "End" the transaction
TransactionManager.Instance.TransactionTaskDone()

#Assign your output to the OUT variable
OUT = sheets
# ----------------------------------------
