# Dynamo graph dllImport.dyn (Dynamo 1.3.1.1736)

select_model_elements = DSModelElementsSelection()
code_block = CodeBlock { "Type"; }
getParameterValueByName = Element.GetParameterValueByName(element=select_model_elements, parameterName=code_block, lacing=Longest)
code_block_2 = CodeBlock { {"b","h"}; }
getParameterValueByName_2 = Element.GetParameterValueByName(element=getParameterValueByName, parameterName=code_block_2, lacing=CrossProduct)
firstItem = List.FirstItem(getParameterValueByName_2, lacing=Longest)
lastItem = List.LastItem(getParameterValueByName_2, lacing=Longest)
code_block_3 = CodeBlock(a=firstItem, b=lastItem) { a*b; }
code_block_4 = CodeBlock { 2500; }
code_block_5 = CodeBlock { 55; }
code_block_6 = CodeBlock { 0; }
unreinforcedShearLimit = DesignCheck.Concrete.EC2.Default.UnreinforcedShearLimit.UnreinforcedShearLimit(firstItem, lastItem, code_block_3, code_block_4, code_block_5, code_block_6)
V_Rdc_min = DesignCheck.Concrete.EC2.Default.UnreinforcedShearLimit.V_Rdc_min(unreinforcedShearLimit)
