# Dynamo graph export schedules.dyn (Dynamo 0.8.2.2392)

element_types = ElementTypes("ViewSchedule")
all_elements_of_type = ElementsOfType(element_types)
name = Element.Name(all_elements_of_type)
code_block = CodeBlock { "QTO"; }
code_block_2 = CodeBlock { 1; }
contains = String.Contains(str=name, searchFor=code_block, ignoreCase=code_block_2)
filterByBoolMask = List.FilterByBoolMask(list=all_elements_of_type, mask=contains)
directory_path = Directory("C:\Users\giovanni.brogioli\Desktop")
name_2 = Element.Name(filterByBoolMask.in)
code_block_3 = CodeBlock { 0; }
code_block_4 = CodeBlock { 3; }
remove = String.Remove(str=name_2, startIndex=code_block_3, count=code_block_4)
code_block_5 = CodeBlock(Name=remove) { Name + ".txt"; }
python_script = Python(IN[0]=filterByBoolMask.in, IN[1]=directory_path, IN[2]=code_block_5)
# ---------- python_script.python (22 lines) ----------
import clr
clr.AddReference('RevitAPI')
from Autodesk.Revit.DB import *

#The inputs to this node will be stored as a list in the IN variables.
schedule = IN[0]
path = IN[1]
filename_list = IN[2]
result = []

for index,sched in enumerate(schedule):
	schedule = UnwrapElement(sched)
	filename = filename_list[index]
	try:
		export_options = ViewScheduleExportOptions()
		schedule.Export(path,filename,export_options)
		result.append("Schedule Exported")
	except:
		result.append("Export failure")

#Assign your output to the OUT variable.
OUT = result
# ----------------------------------------
