# Dynamo graph getWorksetName.dyn (Dynamo 1.3.1.1736)

select_model_elements = DSModelElementsSelection()  # 1 picked in the model
workset = Custom[Element.Workset](element=select_model_elements)  # Retrieves the workset of a given element
name = Element.Name(workset)
python_script = Python(IN[0]=select_model_elements)
# ---------- python_script.python (17 lines) ----------
import clr
clr.AddReference('RevitAPI')
from Autodesk.Revit.DB import *

clr.AddReference("RevitServices")
import RevitServices
from RevitServices.Persistence import DocumentManager

doc = DocumentManager.Instance.CurrentDBDocument

faminsts = UnwrapElement(IN[0])


elementlist = doc.GetWorksetTable().GetWorkset(faminsts.WorksetId)


OUT = elementlist.Name
# ----------------------------------------
code_block = CodeBlock(a=select_model_elements) { {a}; }
python_script_2 = Python(IN[0]=code_block)
# ---------- python_script_2.python (17 lines) ----------
import clr
clr.AddReference('RevitAPI')
from Autodesk.Revit.DB import *

clr.AddReference("RevitServices")
import RevitServices
from RevitServices.Persistence import DocumentManager

doc = DocumentManager.Instance.CurrentDBDocument
faminsts = UnwrapElement(IN[0])
elementlist = list()
for item in faminsts:
	try:
		elementlist.append(doc.GetWorksetTable().GetWorkset(item.WorksetId).Name)
	except:
		elementlist.append(list())
OUT = elementlist
# ----------------------------------------
select_model_elements_2 = DSModelElementsSelection()  # 3 picked in the model
curves = Element.Curves(select_model_elements_2)
flatten = Flatten(curves)
select_model_elements_3 = DSModelElementsSelection()  # 3 picked in the model
curves_2 = Element.Curves(select_model_elements_3)
flatten_2 = Flatten(curves_2)
intersect = Geometry.Intersect(geometry=flatten, other=flatten_2)
flatten_3 = Flatten(intersect)
python_script_3 = Python(IN[0]=flatten_3)
# ---------- python_script_3.python (18 lines) ----------
import clr
clr.AddReference('RevitAPI')
from Autodesk.Revit.DB import *

clr.AddReference("RevitServices")
import RevitServices
from RevitServices.Persistence import DocumentManager

doc = DocumentManager.Instance.CurrentDBDocument

list = UnwrapElement(IN[0])
tipo = []

for item in list:
	tipo.append(item.GetType())


OUT = tipo
# ----------------------------------------
intersectAll = Curve.IntersectAll(flatten)
python_script_4 = Python(IN[0]=flatten_3)
# ---------- python_script_4.python (15 lines) ----------
import clr
clr.AddReference('RevitAPI')
from Autodesk.Revit.DB import *

clr.AddReference("RevitServices")
import RevitServices
from RevitServices.Persistence import DocumentManager

doc = DocumentManager.Instance.CurrentDBDocument

list = UnwrapElement(IN[0])



OUT = dir(list[0])
# ----------------------------------------
select_model_element = DSModelElementSelection()  # 1 picked in the model
python_script_5 = Python(IN[0]=select_model_element)
# ---------- python_script_5.python (34 lines) ----------
import clr
clr.AddReference("ProtoGeometry")
from Autodesk.DesignScript.Geometry import *
# Import RevitAPI
clr.AddReference("RevitAPI")
from Autodesk.Revit.DB import *
clr.AddReference("RevitAPIUI")
from Autodesk.Revit.UI import TaskDialog
# Import DocumentManager and TransactionManager
clr.AddReference("RevitServices")
from RevitServices.Persistence import DocumentManager
from RevitServices.Transactions import TransactionManager
# Import ToProtoType, ToRevitType geometry conversion extension methods
clr.AddReference("RevitNodes")
import Revit
clr.ImportExtensions(Revit.GeometryConversion)

doc = DocumentManager.Instance.CurrentDBDocument
uiapp = DocumentManager.Instance.CurrentUIApplication
app = uiapp.Application

column = UnwrapElement(IN[0])

newPlace = XYZ(10, 20, 30);

# "Start" the transaction
TransactionManager.Instance.EnsureInTransaction(doc)

ElementTransformUtils.MoveElement(doc, column.Id, newPlace);

# "End" the transaction
TransactionManager.Instance.TransactionTaskDone()

OUT = "done"
# ----------------------------------------
