# Dynamo graph gridLevelIntersectv08-01.dyn (Dynamo 0.8.2.2392)

XY = Plane.XY()
select_model_elements = DSModelElementsSelection()  # 10 picked in the model
curve = Grid.Curve(select_model_elements)

# group: LINE
select_model_element = DSModelElementSelection()  # 1 picked in the model
curves = Element.Curves(select_model_element)
pullOntoPlane = Curve.PullOntoPlane(curve=curves, plane=XY)
intersect = Geometry.Intersect(geometry=pullOntoPlane, other=curve, lacing=Longest)

# group: VIEW
views = Views("WORKING - VIEW C WEST ELEVATION")
code_block = CodeBlock(a=views) { {a}; }
python_script = Python(IN[0]=code_block)
# ---------- python_script.python (20 lines) ----------
import clr
clr.AddReference('RevitAPI')
from Autodesk.Revit.DB import *

clr.AddReference("RevitNodes")
import Revit
clr.ImportExtensions(Revit.GeometryConversion)

items = UnwrapElement(IN[0])
dlist = list()

origin = []

for item in items:
	try:
		dlist.append(item.ViewDirection.ToVector())
		origin.append(item.Origin.ToPoint())
	except:
		dlist.append(None)
OUT = dlist, origin
# ----------------------------------------
code_block_2 = CodeBlock(a=python_script) { a[0]; a[1]; }
code_block_3 = CodeBlock(a=code_block_2.out1) { Autodesk.Point.ByCoordinates(a.X,a.Y,0); }
byOriginNormal = Plane.ByOriginNormal(origin=code_block_3, normal=code_block_2.out0)
intersect_2 = Geometry.Intersect(geometry=byOriginNormal, other=curve, lacing=Longest)

flatten = Flatten(intersect_2)
code_block_4 = CodeBlock(a=code_block_2.out1) { a.X; a.Y; }
select_model_elements_2 = DSModelElementsSelection()  # 4 picked in the model
elevation = Level.Elevation(select_model_elements_2)
byCoordinates = Point.ByCoordinates(x=code_block_4.out0, y=code_block_4.out1, z=elevation, lacing=Longest)
ZAxis = Vector.ZAxis()
byOriginNormal_2 = Plane.ByOriginNormal(origin=byCoordinates, normal=ZAxis)
project = Point.Project(flatten, byOriginNormal_2, ZAxis, lacing=CrossProduct)
flatten_2 = Flatten(project)
count = Count(elevation)
chop = List.Chop(flatten_2, count)
family_types = FamilyTypes("Family1:Family1")
python_script_2 = Python()
# ---------- python_script_2.python (30 lines) ----------
import clr
clr.AddReference('ProtoGeometry')
from Autodesk.DesignScript.Geometry import *

clr.AddReference("RevitNodes")
import Revit
clr.ImportExtensions(Revit.Elements)

clr.ImportExtensions(Revit.GeometryConversion)

clr.AddReference("RevitServices")
import RevitServices
from RevitServices.Persistence import DocumentManager
from RevitServices.Transactions import TransactionManager
from System.Collections.Generic import *

clr.AddReference("RevitAPI")
import Autodesk
from Autodesk.Revit.DB import *

doc = DocumentManager.Instance.CurrentDBDocument
uiapp = DocumentManager.Instance.CurrentUIApplication
app = uiapp.Application
uidoc=DocumentManager.Instance.CurrentUIApplication.ActiveUIDocument

select = []
elements = []
select = uidoc.ActiveView

OUT = select
# ----------------------------------------
byPointInView = Custom[FamilyInstance.ByPointInView](point=chop, familyType=family_types, view=python_script_2)  # Places a family instance at a given point in a given view (e.g. a detail component).
code_block_5 = CodeBlock { "tag"; }
name = Level.Name(select_model_elements_2)
name_2 = Element.Name(select_model_elements)
python_script_3 = Python(IN[0]=name, IN[1]=name_2)
# ---------- python_script_3.python (19 lines) ----------
import clr
clr.AddReference('ProtoGeometry')
from Autodesk.DesignScript.Geometry import *
#The inputs to this node will be stored as a list in the IN variables.

lvl = IN[0]

grids = IN[1]

newlvl = []

for i in range(0,len(lvl)):
	nl = []
	newlvl.append(nl)
	for j in range(0,len(grids)):
		nl.append(lvl[i][0:3]+"_"+grids[j])

#Assign your output to the OUT variable.
OUT = newlvl
# ----------------------------------------
transpose = List.Transpose(python_script_3)
setParameterByName = Element.SetParameterByName(element=byPointInView, parameterName=code_block_5, value=transpose)
code_block_6 = CodeBlock { 180; }
setRotation = FamilyInstance.SetRotation(familyInstance=byPointInView, degree=code_block_6)
