# Dynamo graph iterative sum.dyn (Dynamo 1.2.1.3083)

code_block = CodeBlock { {101,10}; }
getKeys = GetKeys(code_block)
code_block_2 = CodeBlock(keys=getKeys) { 0..keys+1; }
getItemAtIndex = List.GetItemAtIndex(list=code_block, index=code_block_2)
sum = Math.Sum(getItemAtIndex)
add = _ + _  # unwired: arg0, arg1
code_block_3 = CodeBlock { 101; }
code_block_4 = CodeBlock { 10; }
code_block_5 = CodeBlock { 10; }
cycle = List.Cycle(list=code_block_4, amount=code_block_5)
scan = ScanList(add, code_block_3, cycle)  # "List.Scan"
