# Dynamo graph journalParse.dyn (Dynamo 1.3.1.1736)

file_path = Filename("..\Desktop\jurnalCoords.txt")
string = StringInput("\s*Jrn.MouseMove\s*([^\n]*)")
file_path_2 = Filename(".\journal.0291.txt")
fromPath = FileObject(file_path_2)  # "File.FromPath"
readText = File.ReadText(fromPath)
findRegularExpression = Custom[String.FindRegularExpression](RegEx=string, str=readText)  # Returns all occurences of a regular expression within a string (or list of strings). The syntax for regular expressions is explained at http://ironpython-test.readthedocs.org/en/latest/howto/regex.html
code_block = CodeBlock { ","; }
split = String.Split(findRegularExpression, code_block)
toNumber = String.ToNumber(split)
string_from_object = FromObject(toNumber)
deconstruct = List.Deconstruct(list=string_from_object, lacing=Longest)
string_from_array = FromArray(deconstruct.rest)
writeToFile = CSV.WriteToFile(file_path, string_from_array)
writeText = File.WriteText(file_path)  # unwired: arg1
