# Dynamo graph json.dyn (Dynamo 1.3.2.2480)

file_path = Filename("C:\Users\giovanni.brogiolo\Documents\249616-ARP-M3-S_R17.json")
fromJsonFile = JsonData.Utilities.Read.FromJsonFile(file_path)
code_block = CodeBlock { "structural_elements.beams"; }
getValueByKey = JsonData.Elements.JsonObject.GetValueByKey(fromJsonFile, code_block)
keys = JsonData.Elements.JsonObject.Keys(getValueByKey)
getValueByKey_2 = JsonData.Elements.JsonObject.GetValueByKey(getValueByKey, keys)
code_block_2 = CodeBlock { "start_node"; }
getValueByKey_3 = JsonData.Elements.JsonObject.GetValueByKey(getValueByKey_2, code_block_2)
code_block_3 = CodeBlock { 0; }
getItemAtIndex = List.GetItemAtIndex(list=getValueByKey_3@L2, index=code_block_3)
code_block_4 = CodeBlock { 1; }
getItemAtIndex_2 = List.GetItemAtIndex(list=getValueByKey_3@L2, index=code_block_4)
code_block_5 = CodeBlock { 2; }
getItemAtIndex_3 = List.GetItemAtIndex(list=getValueByKey_3@L2, index=code_block_5)
byCoordinates = Point.ByCoordinates(x=getItemAtIndex, y=getItemAtIndex_2, z=getItemAtIndex_3)
code_block_6 = CodeBlock { "end_node"; }
getValueByKey_4 = JsonData.Elements.JsonObject.GetValueByKey(getValueByKey_2, code_block_6)
code_block_7 = CodeBlock { 0; }
getItemAtIndex_4 = List.GetItemAtIndex(list=getValueByKey_4@L2, index=code_block_7)
code_block_8 = CodeBlock { 1; }
getItemAtIndex_5 = List.GetItemAtIndex(list=getValueByKey_4@L2, index=code_block_8)
code_block_9 = CodeBlock { 2; }
getItemAtIndex_6 = List.GetItemAtIndex(list=getValueByKey_4@L2, index=code_block_9)
byCoordinates_2 = Point.ByCoordinates(x=getItemAtIndex_4, y=getItemAtIndex_5, z=getItemAtIndex_6)
byStartPointEndPoint = Line.ByStartPointEndPoint(startPoint=byCoordinates, endPoint=byCoordinates_2)
string = StringInput("structural_elements.columns.linear_element")
getValueByKey_5 = JsonData.Elements.JsonObject.GetValueByKey(arg1=string)  # unwired: arg0
keys_2 = JsonData.Elements.JsonObject.Keys(fromJsonFile)
code_block_10 = CodeBlock { "structural_elements"; }
getValueByKey_6 = JsonData.Elements.JsonObject.GetValueByKey(fromJsonFile, code_block_10)
keys_3 = JsonData.Elements.JsonObject.Keys(getValueByKey_6)
