# Dynamo graph nexT.dyn (Dynamo 1.3.0.875)

elements = JsonElements.JsonArray.Elements()  # unwired: arg0
file_path = Filename("C:\Users\giovanni.brogiolo\Documents\NetX.ipynb")
fromPath = FileObject(file_path)  # "File.FromPath"
readText = File.ReadText(fromPath)
parseJsonString = JsonTools.JsonTools.ParseJsonString(readText)
keys = JsonElements.JsonObject.Keys(parseJsonString)
values = JsonElements.JsonObject.Values(parseJsonString)
code_block = CodeBlock(a=values) { a[0]; }
watch = Watch(code_block)
readFromFile = DynamoJson.FileHelper.ReadFromFile(file_path)
toDictionary = DynamoJson.JsonParser.ToDictionary(readFromFile)
