# Dynamo graph placeAitTerminal.dyn (Dynamo 1.3.1.1736)

categories = Categories("Rooms")
all_elements_of_category = ElementsOfCategory(categories)
code_block = CodeBlock { "Number"; }
getParameterValueByName = Element.GetParameterValueByName(element=all_elements_of_category, parameterName=code_block)
family_types = FamilyTypes("Arup_AirTerminal_SupplyFloorRectGrilleRectSpigot:600L x 600W x 150H mm")
location = Room.Location(all_elements_of_category)
byPoint = FamilyInstance.ByPoint(familyType=family_types, point=location)
setParameterByName = Element.SetParameterByName(element=byPoint)  # unwired: parameterName, value
