# Dynamo graph placeLegend.dyn (Dynamo 1.3.2.2480)

views = Views("Legend Beam Reinforcement-Lig Types")
python_script = Python(IN[0]=views)
# ---------- python_script.python (34 lines) ----------
#python nodes in dynamo 1.2
#proposed by Julien Benoit @jbenoit44 
#http://aecuandme.wordpress.com/
import clr
clr.AddReference('ProtoGeometry')
from Autodesk.DesignScript.Geometry import *
# Import ToDSType(bool) extension method
clr.AddReference("RevitNodes")
import Revit
clr.ImportExtensions(Revit.Elements)
# Import geometry conversion extension methods
clr.ImportExtensions(Revit.GeometryConversion)
# Import DocumentManager and TransactionManager
clr.AddReference("RevitServices")
import RevitServices
from RevitServices.Persistence import DocumentManager
from RevitServices.Transactions import TransactionManager
from System.Collections.Generic import *
# Import RevitAPI
clr.AddReference("RevitAPI")
import Autodesk
from Autodesk.Revit.DB import *

doc = DocumentManager.Instance.CurrentDBDocument
uiapp = DocumentManager.Instance.CurrentUIApplication
app = uiapp.Application
uidoc=DocumentManager.Instance.CurrentUIApplication.ActiveUIDocument


views=UnwrapElement(IN[0])



OUT=views.Id
# ----------------------------------------
categories = Categories("Sheets")
all_elements_of_category = ElementsOfCategory(categories)
name = Element.Name(all_elements_of_category)
code_block = CodeBlock { "Beam Reinf"; }
contains = String.Contains(str=name, searchFor=code_block)
filterByBoolMask = List.FilterByBoolMask(list=all_elements_of_category, mask=contains)
code_block_2 = CodeBlock(a=views) { {a}; }
select_model_element = DSModelElementSelection()  # 1 picked in the model
locationData = Rhythm.Revit.Elements.Viewport.LocationData(select_model_element)
count = Count(filterByBoolMask.in)
cycle = List.Cycle(list=locationData.out1, amount=count)
create = Rhythm.Revit.Elements.Viewport.Create(filterByBoolMask.in, code_block_2, cycle, lacing=Longest)
flatten = Flatten(create)
viewports = archilab.Revit.Views.Sheets.Viewports(filterByBoolMask.in)
name_2 = Element.Name(viewports)
code_block_3 = CodeBlock { "Type"; }
code_block_4 = CodeBlock(a=viewports) { a[0][0]; }
getParameterValueByName = Element.GetParameterValueByName(element=code_block_4, parameterName=code_block_3)
setParameterByName = Element.SetParameterByName(element=viewports, parameterName=code_block_3, value=getParameterValueByName)
code_block_5 = CodeBlock(a=viewports) { a[0][1]; }
parameters = Element.Parameters(code_block_5)
storageType = Parameter.StorageType(parameters)
element_types = ElementTypes("Viewport")
all_elements_of_type = ElementsOfType(element_types)
name_3 = Element.Name(getParameterValueByName)
