# Dynamo graph rename families.dyn (Dynamo 1.2.1.3083)

get_family_and_type_list_for = Custom[Get Family and Type List for Project]()
name = FamilyType.Name(get_family_and_type_list_for.Type_List)

# group: SELECT THE FAMILY TYPE
code_block = CodeBlock { "UKB"; }

code_block_2 = CodeBlock { 1; }
contains = String.Contains(str=name, searchFor=code_block, ignoreCase=code_block_2)
filterByBoolMask = List.FilterByBoolMask(list=get_family_and_type_list_for.Type_List, mask=contains)
filterByBoolMask_2 = List.FilterByBoolMask(list=name, mask=contains)
code_block_3 = CodeBlock(a=filterByBoolMask_2.in) { "Giovanni "+a; }
setName = Custom[Element.SetName](element=filterByBoolMask.in, name=code_block_3)  # Gets the name of a given Revit element
