# Dynamo graph setParameterByNameLacing.dyn (Dynamo 1.3.1.1736)

select_model_elements = DSModelElementsSelection()  # 3 picked in the model
code_block = CodeBlock { "Comments"; }
code_block_2 = CodeBlock { "Name"; }
join = List.Join(code_block, code_block_2)
select_model_elements_2 = DSModelElementsSelection()  # 3 picked in the model
code_block_3 = CodeBlock { "Mark"; }
code_block_4 = CodeBlock { "Comments"; }
join_2 = List.Join(code_block_3, code_block_4)
getParameterValueByName = Element.GetParameterValueByName(element=select_model_elements_2, parameterName=join_2, lacing=CrossProduct)
setParameterByName = Element.SetParameterByName(element=select_model_elements, parameterName=join@L2, value=getParameterValueByName, lacing=Longest)
