# Dynamo graph setTitleblocks.dyn (Dynamo 0.8.2.2392)

code_block = CodeBlock()
# ---------- code_block.designscript (13 lines) ----------
{203300,
203305,
10603,
10503,
310503,
10301,
10201,
10401,
310201,
310211,
310301,
55031,
345031};
# ----------------------------------------
code_block_2 = CodeBlock { a; }
code_block_3 = CodeBlock { "2017 December 15"; }
setParameterByName = Element.SetParameterByName(value=code_block_3, lacing=Longest)
categories = Categories("TitleBlocks")
all_elements_of_category = ElementsOfCategory(categories)
code_block_4 = CodeBlock { "Sheet Number"; }
getParameterValueByName = Element.GetParameterValueByName(element=all_elements_of_category, parameterName=code_block_4)
python_script = Python(IN[0]=getParameterValueByName)
# ---------- python_script.python (12 lines) ----------
import clr
clr.AddReference('RevitAPI')
from Autodesk.Revit.DB import *

items = UnwrapElement(IN[0])
typelist = list()
for item in items:
	try:
		typelist.append(item.GetType())
	except:
		typelist.append(list())
OUT = typelist
# ----------------------------------------
code_block_5 = CodeBlock()
# ---------- code_block_5.designscript (13 lines) ----------
{"203300",
"203305",
"010603",
"010503",
"310503",
"010301",
"010201",
"010401",
"310201",
"310211",
"310301",
"055031",
"345031"};
# ----------------------------------------
allIndicesOf = List.AllIndicesOf(list=getParameterValueByName, item=code_block_5)
flatten = Flatten(allIndicesOf)
getItemAtIndex = List.GetItemAtIndex(list=all_elements_of_category, index=flatten)
code_block_6 = CodeBlock { "Sheet Issue Date"; }
getParameterValueByName_2 = Element.GetParameterValueByName(element=getItemAtIndex, parameterName=code_block_6)
