# Dynamo graph sqlQuery.dyn (Dynamo 1.3.1.1736)

database = SQLTools.Connect.Database()  # unwired: arg0, arg1, arg2, arg3
server = SQLTools.Connect.Server()  # unwired: arg0, arg1, arg2
string = StringInput("C:\Users\giovanni.brogiolo\Desktop\New folder\test1.sdb")
boolean = BoolSelector(true)
string_2 = StringInput("select * from _objects_attr")
SQLite_Query = Database.Query.SQLite_Query(string, boolean, string_2)
selectFrom = Database.SQL.SelectFrom()  # unwired: arg0, arg1
SQLite_Command = Database.Command.SQLite_Command()  # unwired: arg0, arg1, arg2
mySQL_ConnectionString = Database.Connection.MySQL_ConnectionString()  # unwired: arg0, arg1, arg2, arg3, arg4, arg5
