# Dynamo graph subListTest.dyn (Dynamo 1.3.1.1736)

code_block = CodeBlock { 1..16; }
python_script = Python(IN[0]=code_block)
# ---------- python_script.python (21 lines) ----------
import clr
clr.AddReference('ProtoGeometry')
from Autodesk.DesignScript.Geometry import *
#The inputs to this node will be stored as a list in the IN variables.
pts = IN[0]

subPt = []

for j in range(0,len(pts)/4):
	pt = []
	subPt.append(pt)
	for i in range(0,4):
		try:
			pt.append(pts.pop(0))
		except:
			"done"
	
#subPt.append(pts.pop(0))

#Assign your output to the OUT variable.
OUT = subPt
# ----------------------------------------
python_script_2 = Python(IN[0]=python_script)
# ---------- python_script_2.python (22 lines) ----------
import clr
clr.AddReference('ProtoGeometry')
from Autodesk.DesignScript.Geometry import *
#The inputs to this node will be stored as a list in the IN variables.
pts = IN[0]

subPt = []

for i in range(0,len(pts)):
	pt = []
	subPt.append(pt)
	for j in range(0,2):
		try:
			pt.append(pts[i].pop(0))
			pt.append(pts[i+1].pop(0))
		except:
			"done"
	
#subPt.append(pts.pop(0))

#Assign your output to the OUT variable.
OUT = subPt
# ----------------------------------------
