# Dynamo graph sweep.dyn (Dynamo 0.8.2.2392)

code_block = CodeBlock {  }
select_model_element = DSModelElementSelection()
geometry = Element.Geometry(select_model_element)
explode = Geometry.Explode(geometry)
code_block_2 = CodeBlock(A=explode) { A[0][0]; }
perimeterCurves = Surface.PerimeterCurves(code_block_2)
code_block_3 = CodeBlock { 3; }
removeItemAtIndex = List.RemoveItemAtIndex(list=perimeterCurves, indices=code_block_3)
byCurve = ModelCurve.ByCurve(removeItemAtIndex)
bySweep = Surface.BySweep(arg1=byCurve)
element_types = ElementTypes("AnalysisDisplayLegend")
code_block_4 = CodeBlock(a=removeItemAtIndex) { a[2]; }
code_block_5 = CodeBlock { 0; }
planeAtParameter = Curve.PlaneAtParameter(curve=code_block_4, param=code_block_5)
code_block_6 = CodeBlock { 500; }
byWidthLength = Rectangle.ByWidthLength(plane=planeAtParameter, width=code_block_6, length=code_block_6)
sweepAsSolid = Curve.SweepAsSolid(byWidthLength, removeItemAtIndex)
byJoinedCurves = PolyCurve.ByJoinedCurves(removeItemAtIndex)
