# Dynamo graph tableXml.dyn (Dynamo 1.3.0.875)

code_block = CodeBlock { "ProgettoTest"; }
code_block_2 = CodeBlock { {"idElement","ParameterA","ParameterB","ParameterC"}; }

# group: Element Id
code_block_3 = CodeBlock { "ID"+{1..3}; }

flatten = Flatten(code_block_3)
code_block_4 = CodeBlock { 1..3; }
code_block_5 = CodeBlock { {"a","b","c"}; }
code_block_6 = CodeBlock(code_block_4, code_block_5) { a+b<1L>; }

# group: Element Parameters
transpose = List.Transpose(code_block_6)

addItemToFront = List.AddItemToFront(item=flatten, list=transpose, lacing=Longest)
createDataTable = Lists.DataSets.CreateDataTable(code_block_2, code_block_2, addItemToFront)
code_block_7 = CodeBlock(a=createDataTable) { a[0]; }
createDataSet = Lists.DataSets.CreateDataSet(code_block, code_block_7)
code_block_8 = CodeBlock { true; }
file_path = Filename("..\Desktop\export3")
serializeXML = Lists.DataSets.SerializeXML(createDataSet, code_block_8, file_path, lacing=Longest)
