# Dynamo graph tekla01.dyn (Dynamo 1.3.2.2480)

select_model_elements = DSModelElementsSelection()  # 3 picked in the model
location = StructuralFraming.Location(select_model_elements)
code_block = CodeBlock { 150; 500; }
code_block_2 = CodeBlock { "Steel_Undefined"; }
code_block_3 = CodeBlock { {"MIDDLE"}; }
beam = Arup.DynaTekla.Tekla.Beam(location, code_block.out0, code_block.out1, code_block_2, code_block_3, lacing=Longest)
