# Dynamo graph teklaPanel.dyn (Dynamo 1.3.2.2480)

# group: Line
code_block = CodeBlock { Line.ByStartPointEndPoint(Point.ByCoordinates(0,0,0), Point.ByCoordinates(5000,0,0)); }

code_block_2 = CodeBlock { 250; 3500; }
code_block_3 = CodeBlock { "Wall"; }
code_block_4 = CodeBlock { "Left"; }
overallPosition = Arup.DynaTekla.Tekla.OverallPosition(code_block_4)
code_block_5 = CodeBlock { "Concrete_Undefined"; }
panel = Arup.DynaTekla.Tekla.Panel(code_block, code_block_2.out0, code_block_2.out1, code_block_3, overallPosition, code_block_5)
