# Dynamo custom node AddToFamilyTypesFromList.dyf "ElementTypesMatchList" (Dynamo 0.8.1.1823)
# category: Clockwork.Revit.Elements.ElementType.Actions
# Duplicates an element type

Family = Input()
Names = Input()
turn_into_list = Custom[Turn Into List](item=Names)  # Turns an element into a (flat) list
# note: Creates new family types
# using Duplicate method
python_script = Python(IN[0]=Family, IN[1]=turn_into_list)
# ---------- python_script.python (35 lines) ----------
import clr
clr.AddReference('RevitAPI')
from Autodesk.Revit.DB import *

clr.AddReference("RevitNodes")
import Revit
clr.ImportExtensions(Revit.Elements)

clr.AddReference("RevitServices")
import RevitServices
from RevitServices.Persistence import DocumentManager
from RevitServices.Transactions import TransactionManager

doc = DocumentManager.Instance.CurrentDBDocument
family = UnwrapElement(IN[0])
newNames = IN[1]

nameInList = list()
failedNameList = []
initialSymbolNames = [n.get_Parameter(BuiltInParameter.SYMBOL_NAME_PARAM).AsString() for n in list(family.Symbols)]

TransactionManager.Instance.EnsureInTransaction(doc)
for name in newNames:
	try:
		if name in initialSymbolNames:
			nameInList.append(name)
		else:
			newsym = list(family.Symbols)[0].Duplicate(name)
			nameInList.append(name)
	except BaseException as E:
		failedNameList.append(E[0])
TransactionManager.Instance.TransactionTaskDone()

OUT = [initialSymbolNames, nameInList, failedNameList]
#OUT = nameInList
# ----------------------------------------
# note: 3 Lists in output
# 0 - Initial Symbol List
# 1 - Names to add
# 2 - Names which failed to add
watch = Watch(python_script)
# note: Use codeblock to control
# which list is output
code_block = CodeBlock { 2; }
getItemAtIndex = List.GetItemAtIndex(list=watch, index=code_block)
FailedNames = Output(getItemAtIndex)
