# Dynamo graph ColorByCeilingThickness.dyn (Dynamo 1.0.0.384)

categories = Categories("Ceilings")
all_elements_of_category = ElementsOfCategory(categories)
code_block = CodeBlock()
# ---------- code_block.designscript (3 lines) ----------
{Color.ByARGB(255,255,0,0),
Color.ByARGB(255,0,255,0)};
0..1;
# ----------------------------------------
code_block_2 = CodeBlock { {"Volume","Area"}; }
getParameterValueByName = Element.GetParameterValueByName(element=all_elements_of_category, parameterName=code_block_2, lacing=CrossProduct)
transpose = List.Transpose(getParameterValueByName)
code_block_3 = CodeBlock(h=transpose) { height=h[0]/h[1]; }
remapRange = Math.RemapRange(numbers=code_block_3)
color_range = ColorRange(code_block.out0, code_block.out1, remapRange)
overrideColorInView = Element.OverrideColorInView(element=all_elements_of_category, color=color_range)
