# Dynamo graph Create element by points and level v09.dyn (Dynamo 0.9.1.4062)

file_path = Filename("C:\Users\giovanni.brogioli\Downloads\Import holes data.xlsx")
fromPath = FileObject(file_path)  # "File.FromPath"
code_block = CodeBlock { "Level 00"; }
readFromFile = Excel.ReadFromFile(file=fromPath, sheetName=code_block)
code_block_2 = CodeBlock { 1; }
dropItems = List.DropItems(list=readFromFile, amount=code_block_2)
transpose = List.Transpose(dropItems)
element_creation_inputs = CodeBlock()
# ---------- element_creation_inputs.designscript (20 lines) ----------
//Level;
4;
//x1;
0;
//y1;
1;
//x2;
2;
//y2;
3;
//Type;
5;
//Offset;
6;
//Mark;
7;
//Family Name;
8;
//Family Type;
9;
# ----------------------------------------
family_name = List.GetItemAtIndex(list=transpose, index=element_creation_inputs.out8)
family_type = List.GetItemAtIndex(list=transpose, index=element_creation_inputs.out9)
code_block_3 = CodeBlock(fName=family_name, fType=family_type) { FamilyType.ByFamilyNameAndTypeName(fName,fType); }
x1 = List.GetItemAtIndex(list=transpose, index=element_creation_inputs.out1)
y1 = List.GetItemAtIndex(list=transpose, index=element_creation_inputs.out2)
x2 = List.GetItemAtIndex(list=transpose, index=element_creation_inputs.out3)
y2 = List.GetItemAtIndex(list=transpose, index=element_creation_inputs.out4)
code_block_4 = CodeBlock(x1=x1, y1=y1, x2=x2, y2=y2) { x1; y1; x2; y2; xm = (x1 + x2) / 2; ym = (y1 + y2) / 2; }
byCoordinates = Point.ByCoordinates(x=code_block_4.xm, y=code_block_4.ym)
levels = Levels("00")
byPointAndLevel = FamilyInstance.ByPointAndLevel(familyType=code_block_3, point=byCoordinates, level=levels)
code_block_5 = CodeBlock { "Mark"; "Level"; "Offset"; }
setParameterByName_Offset = Element.SetParameterByName(element=byPointAndLevel, parameterName=code_block_5.out2)  # "Element.SetParameterByName_Offset"
level = List.GetItemAtIndex(list=transpose, index=element_creation_inputs.out0)
byCoordinates_2 = Point.ByCoordinates(x=x1, y=y1)
byCoordinates_3 = Point.ByCoordinates(x=x2, y=y2)
byTwoPoints = Vector.ByTwoPoints(start=byCoordinates_2, end=byCoordinates_3)
code_block_6 = CodeBlock { 0; 1; 0; }
byCoordinates_4 = Vector.ByCoordinates(x=code_block_6.out0, y=code_block_6.out1, z=code_block_6.out2)
angleWithVector = Vector.AngleWithVector(vector=byCoordinates_4)
setParameterByName_Mark = Element.SetParameterByName(element=byPointAndLevel, parameterName=code_block_5.out0)  # "Element.SetParameterByName_Mark"
setRotation = FamilyInstance.SetRotation(familyInstance=byPointAndLevel)
hole_type = List.GetItemAtIndex(list=transpose, index=element_creation_inputs.out5)
z_offset = List.GetItemAtIndex(list=transpose, index=element_creation_inputs.out6)
mark = List.GetItemAtIndex(list=transpose, index=element_creation_inputs.out7)
