# Dynamo graph Create element by points and level.dyn (Dynamo 1.0.0.1180)

file_path = Filename("No file selected.")
fromPath = FileObject(file_path)  # "File.FromPath"
levels = Levels("Level 05")
name = Parameter.Name(levels)
readFromFile = Excel.ReadFromFile(file=fromPath, sheetName=name)
code_block = CodeBlock { 1; }
dropItems = List.DropItems(list=readFromFile, amount=code_block)
transpose = List.Transpose(dropItems)
element_creation_inputs = CodeBlock()
# ---------- element_creation_inputs.designscript (20 lines) ----------
//Level;
4;
//x1;
0;
//y1;
1;
//x2;
2;
//y2;
3;
//Type;
5;
//Offset;
6;
//Mark;
7;
//Family Name;
8;
//Family Type;
9;
# ----------------------------------------
family_name = List.GetItemAtIndex(list=transpose, index=element_creation_inputs.out8)
family_type = List.GetItemAtIndex(list=transpose, index=element_creation_inputs.out9)
code_block_2 = CodeBlock(fName=family_name, fType=family_type) { FamilyType.ByFamilyNameAndTypeName(fName,fType); }
x1 = List.GetItemAtIndex(list=transpose, index=element_creation_inputs.out1)
y1 = List.GetItemAtIndex(list=transpose, index=element_creation_inputs.out2)
x2 = List.GetItemAtIndex(list=transpose, index=element_creation_inputs.out3)
y2 = List.GetItemAtIndex(list=transpose, index=element_creation_inputs.out4)
code_block_3 = CodeBlock(x1=x1, y1=y1, x2=x2, y2=y2) { x1; y1; x2; y2; xm = (x1 + x2) / 2; ym = (y1 + y2) / 2; }
byCoordinates = Point.ByCoordinates(x=code_block_3.xm, y=code_block_3.ym)
byPointAndLevel = FamilyInstance.ByPointAndLevel(familyType=code_block_2, point=byCoordinates, level=levels)
code_block_4 = CodeBlock { "Mark"; "Level"; "Offset"; }
z_offset = List.GetItemAtIndex(list=transpose, index=element_creation_inputs.out6)
setParameterByName_Offset = Element.SetParameterByName(element=byPointAndLevel, parameterName=code_block_4.out2, value=z_offset)  # "Element.SetParameterByName_Offset"
level = List.GetItemAtIndex(list=transpose, index=element_creation_inputs.out0)
mark = List.GetItemAtIndex(list=transpose, index=element_creation_inputs.out7)
setParameterByName_Mark = Element.SetParameterByName(element=byPointAndLevel, parameterName=code_block_4.out0, value=mark)  # "Element.SetParameterByName_Mark"
code_block_5 = CodeBlock { 0; 1; 0; }
byCoordinates_2 = Vector.ByCoordinates(x=code_block_5.out0, y=code_block_5.out1, z=code_block_5.out2)
byCoordinates_3 = Point.ByCoordinates(x=x1, y=y1)
byCoordinates_4 = Point.ByCoordinates(x=x2, y=y2)
byTwoPoints = Vector.ByTwoPoints(start=byCoordinates_3, end=byCoordinates_4)
angleWithVector = Vector.AngleWithVector(vector=byCoordinates_2, otherVector=byTwoPoints)
setRotation = FamilyInstance.SetRotation(familyInstance=byPointAndLevel, degree=angleWithVector)
hole_type = List.GetItemAtIndex(list=transpose, index=element_creation_inputs.out5)
