# Dynamo custom node CutGeometry.dyf (Dynamo 0.8.2.2392)
# category: Hot Gear.Geometry Cut

ElementList = Input(ElementList : var[]..[])
cancut = Python(IN[0]=ElementList)
# ---------- cancut.python (34 lines) ----------
import clr
clr.AddReference('ProtoGeometry')
from Autodesk.DesignScript.Geometry import *

clr.AddReference("RevitAPI")
import Autodesk
from Autodesk.Revit.DB import *

clr.AddReference("RevitServices")
import RevitServices
from RevitServices.Persistence import DocumentManager
from RevitServices.Transactions import TransactionManager
from System.Collections.Generic import *

clr.AddReference("RevitNodes")
import Revit
clr.ImportExtensions(Revit.Elements)

doc = DocumentManager.Instance.CurrentDBDocument
TransactionManager.Instance.EnsureInTransaction(doc)

element = UnwrapElement(IN[0])

end = []
sublist = []

for CBCWV in element:
	result = Autodesk.Revit.DB.InstanceVoidCutUtils.CanBeCutWithVoid(CBCWV)
	sublist.append(result)
		
end.extend(sublist)

TransactionManager.Instance.TransactionTaskDone()
OUT = end
# ----------------------------------------
filterByBoolMask = List.FilterByBoolMask(list=ElementList, mask=cancut)
join = List.Join(filterByBoolMask.in, filterByBoolMask.out)
code_block = CodeBlock(item=join) { a=Flatten({item}); List.Combinations(a,2,false); }
cut_python_script = Python(IN[0]=code_block.out1)
# ---------- cut_python_script.python (38 lines) ----------
import clr
clr.AddReference('ProtoGeometry')
from Autodesk.DesignScript.Geometry import *

clr.AddReference("RevitAPI")
import Autodesk
from Autodesk.Revit.DB import *

clr.AddReference("RevitServices")
import RevitServices
from RevitServices.Persistence import DocumentManager
from RevitServices.Transactions import TransactionManager
from System.Collections.Generic import *

clr.AddReference("RevitNodes")
import Revit
clr.ImportExtensions(Revit.Elements)

doc = DocumentManager.Instance.CurrentDBDocument
TransactionManager.Instance.EnsureInTransaction(doc)

element = UnwrapElement(IN[0])
list = len(element)
count = 0
sublist = []

while (count < list):
	try:
		result = Autodesk.Revit.DB.InstanceVoidCutUtils.AddInstanceVoidCut(doc, element[count][0], element[count][1])
		count
		count = count + 1
		sublist.append("Seccess")
	except:
		count
		count = count +1

TransactionManager.Instance.TransactionTaskDone()
OUT = sublist
# ----------------------------------------
OUT = Output(cut_python_script)
