# Dynamo graph DynamoToFlux.dyn (Dynamo 1.0.0.1180)

# group: Connect the "Cuboid" output to the "Value" input in the Send to Flux component.
byCorners = Cuboid.ByCorners()

# group: Flux workflow to select the project and data key that you would like to work with.
flux_project = ProjectsNodeModel()
flowControl = FlowControlNodeModel()
send_to_flux = ToFluxNodeModel(flux_project, flowControl)
