# Dynamo graph Export-Import-to-excel.dyn (Dynamo 0.8.1.1823)

code_block = CodeBlock { "Sheet1"; 0; "True"; }
code_block_2 = CodeBlock { {"Element ID","Comments","Mark"}; }
select_model_elements = DSModelElementsSelection()  # 6 picked in the model
id = Element.Id(select_model_elements)
code_block_3 = CodeBlock { "Comments"; "Mark"; }
getParameterValueByName = Element.GetParameterValueByName(element=select_model_elements, parameterName=code_block_3.out0)
getParameterValueByName_2 = Element.GetParameterValueByName(element=select_model_elements, parameterName=code_block_3.out1)
create = List.Create(id, getParameterValueByName, getParameterValueByName_2)
transpose = List.Transpose(create)
addItemToFront = List.AddItemToFront(item=code_block_2, list=transpose)
writeToFile = Excel.WriteToFile(sheetName=code_block.out0, startRow=code_block.out1, startCol=code_block.out1, data=addItemToFront, overWrite=code_block.out2)
file_path = Filename("C:\Test\test.xlsx")
fromPath = FileObject()  # "File.FromPath"
readFromFile = Excel.ReadFromFile(file=fromPath, sheetName=code_block.out0, readAsStrings=code_block.out2)
code_block_4 = CodeBlock { 1; }
dropItems = List.DropItems(list=readFromFile, amount=code_block_4)
transpose_2 = List.Transpose(dropItems)
code_block_5 = CodeBlock { 0; 1; 2; }
getItemAtIndex = List.GetItemAtIndex(list=transpose_2, index=code_block_5.out0)
current_document = Custom[Current Document]()  # Retrieves Current Document
id_to_element = Custom[Id to Element](Id_s=getItemAtIndex, Doc=current_document)  # Selects elements in a model from id input (ElementId, string, integer or GUID)
code_block_6 = CodeBlock { "Comments"; "Mark"; }
getItemAtIndex_2 = List.GetItemAtIndex(list=transpose_2, index=code_block_5.out2)
setParameterByName = Element.SetParameterByName(element=id_to_element, parameterName=code_block_6.out1, value=getItemAtIndex_2)
getItemAtIndex_3 = List.GetItemAtIndex(list=transpose_2, index=code_block_5.out1)
setParameterByName_2 = Element.SetParameterByName(element=id_to_element, parameterName=code_block_6.out0, value=getItemAtIndex_3)
