# Dynamo graph Filters v4.dyn (Dynamo 0.9.2.4472)

categories = Categories("DuctFitting")
categories_2 = Categories("DuctCurves")
create = List.Create(categories, categories_2)
listBuiltInParameters = Custom[Document.ListBuiltInParameters]()  # List all the available BuiltInParameters
RBS_DUCT_SYSTEM_PARAM = CodeBlock(IN=listBuiltInParameters) { IN[1441]; }
pValue = CodeBlock { "M - Supply Air - General"; }
view_template = ViewTemplatesUI("70 - Sh - M - Ventilation Double Line - Layout")
element_types = ElementTypes("FillPatternElement")
all_elements_of_type = ElementsOfType(element_types)
code_block = CodeBlock(x=all_elements_of_type) { x[0]; }
element_types_2 = ElementTypes("FilterElement")
all_elements_of_type_2 = ElementsOfType(element_types_2)
name = Element.Name(all_elements_of_type_2)
filter_name = CodeBlock { "M - Ventilation - Supply Air - General"; }
eq = name == filter_name
filterByBoolMask = List.FilterByBoolMask(list=all_elements_of_type_2, mask=eq)

# group: Kolor
code_block_2 = CodeBlock { 100; }
code_block_3 = CodeBlock { 000; }
code_block_4 = CodeBlock { 100; }

python_script = Python(IN[0]=create, IN[1]=RBS_DUCT_SYSTEM_PARAM, IN[2]=pValue, IN[3]=view_template, IN[4]=code_block, IN[5]=filterByBoolMask.in, IN[6]=filter_name, IN[7]=code_block_2, IN[8]=code_block_3, IN[9]=code_block_4)
# ---------- python_script.python (79 lines) ----------
# Based on K. Sobon work from Archi-Lab.net

import clr
clr.AddReference('RevitServices')
import RevitServices
from RevitServices.Persistence import DocumentManager
from RevitServices.Transactions import TransactionManager
doc = DocumentManager.Instance.CurrentDBDocument
clr.AddReference('RevitAPI')
import Autodesk
from Autodesk.Revit.DB import *
import System
from System.Collections.Generic import *

dataEnteringNode = IN

def GetBuiltInParam(paramName):
	builtInParams = System.Enum.GetValues(BuiltInParameter)
	test = []
	for i in builtInParams:
		if i.ToString() == paramName:
			try:
				test.append(i)
			except:
				pass
	return test[0]

def tolist(obj1):
	if hasattr(obj1,"__iter__"):
		return obj1
	else:
		return [obj1]


cats = IN[0]  #categories
paramName = IN[1] #builtInParameters
pValue = IN[2] #builtInParameters value
view = UnwrapElement(IN[3]) #view
fillPattern = UnwrapElement(IN[4]) #fillPattern
resetFilters = UnwrapElement(tolist(IN[5])) #in order to override filter we need to recreate it
filterName = IN[6] #filterName
colorR = IN[7] #colour R
colorG = IN[8] #colour G
colorB = IN[9] #colour B


filtersIdToReset = List[ElementId]()
for i in resetFilters:
	if i.ToString() == filterName.ToString():
		pass
	else:
			filtersIdToReset.Add(i.Id)
	
TransactionManager.Instance.EnsureInTransaction(doc)

catList = []
for i in cats:
	catList.append(ElementId(i.Id))

typedCatList = List[ElementId](catList)
rules = []

bip = GetBuiltInParam(paramName)

rules.append(ParameterFilterRuleFactory.CreateEqualsRule(ElementId(bip), pValue, True))

try:
	reset = doc.Delete(filtersIdToReset)
	filter = ParameterFilterElement.Create(doc, filterName, typedCatList, rules)
	view.AddFilter(filter.Id)
	ogs = OverrideGraphicSettings()
	ogs.SetProjectionFillColor(Color(colorR,colorG,colorB)).SetProjectionFillPatternId(fillPattern.Id)
	view.SetFilterOverrides(filter.Id, ogs)
except:
	pass

TransactionManager.Instance.TransactionTaskDone()

OUT = [view]
# ----------------------------------------
code_block_5 = CodeBlock(IN=listBuiltInParameters) { IN[1734]; }
