# Dynamo graph Override Colours.dyn (Dynamo 0.9.1.4062)

# group: INPUT: FILLED REGION
select_model_elements = DSModelElementsSelection()

code_block = CodeBlock { 255; 0; }
byARGB = Color.ByARGB(r=code_block.out0, g=code_block.out1, b=code_block.out1)
byARGB_2 = Color.ByARGB(r=code_block.out1, g=code_block.out0, b=code_block.out1)
byARGB_3 = Color.ByARGB(r=code_block.out1, g=code_block.out1, b=code_block.out0)
create = List.Create(byARGB, byARGB_2, byARGB_3)

# group: INPUT: Family
categories = Categories("StructuralFraming")

all_placed_family_types_of = Custom[All Placed Family Types of Category](category=categories)  # Retrieves all family types of a given category that have *placed* instances
count = Count(all_placed_family_types_of)
code_block_2 = CodeBlock(a=count) { 0..1..#a; }
color_range = ColorRange(create, arg2=code_block_2)
overrideColorInView = Element.OverrideColorInView(element=select_model_elements, color=color_range)
all_elements_of_category = ElementsOfCategory(categories)
code_block_3 = CodeBlock { "Mark"; }
setParameterByName = Element.SetParameterByName(element=select_model_elements, parameterName=code_block_3)
overrideColorInView_2 = Element.OverrideColorInView()
structural_framing_types = StructuralFramingTypes("1025dp x 500w")
all_elements_of_family_type = Custom[All Elements of Family Type (Universal)](familyType=all_placed_family_types_of)  # Unlike the built-in node, this node retrieves all placed instances of a given loadable *or* system family type
subcategories = Custom[Category.Subcategories](category=categories)  # Retrieves all the subcategories for a given category
categories_2 = Categories("AdaptivePoints")
