# Dynamo graph Revit Filter.dyn (Dynamo 1.0.0.1180)

views = Views("Level 3")
categories = Categories("Walls")
create = List.Create(categories)
all_elements_of_category = ElementsOfCategory(categories)
code_block = CodeBlock(IN=all_elements_of_category) { IN[0]; }
get_builtinparameter_name = ItemSelector("Width | WALL_ATTR_WIDTH_PARAM | double | ReadOnly", code_block)
code_block_2 = CodeBlock { 0.5; }
get_all_views = Custom[Get All Views]()  # This node will query all views in the model and return them based on category
python_script = Python(IN[0]=create, IN[1]=get_builtinparameter_name, IN[2]=code_block_2, IN[3]=get_all_views.Engineering_Plans)
# ---------- python_script.python (58 lines) ----------
import clr
clr.AddReference('ProtoGeometry')
from Autodesk.DesignScript.Geometry import *

import clr
clr.AddReference("RevitServices")
import RevitServices
from RevitServices.Persistence import DocumentManager
from RevitServices.Transactions import TransactionManager
doc = DocumentManager.Instance.CurrentDBDocument
clr.AddReference("RevitAPI")

import Autodesk
from Autodesk.Revit.DB import *
import System
from System.Collections.Generic import *

dataEnteringNode = IN

def GetBuiltInParam(paramName):
	builtInParams = System.Enum.GetValues(BuiltInParameter)
	test = []
	for i in builtInParams:
		if i.ToString() == paramName:
			test.append(i)
			break
		else:
			continue
	return test[0]

cats = IN[0]
paramName = IN[1]
pValue = IN [2]
view = UnwrapElement(IN[3])

TransactionManager.Instance.EnsureInTransaction(doc)

catList = []
for i in cats:
	catList.append(ElementId(i.Id))

typedCatList = List[ElementId](catList)
rules = []

bip = GetBuiltInParam(paramName)

rules.append(ParameterFilterRuleFactory.CreateLessRule(ElementId(bip), pValue, 0.001))

try:
	filter = ParameterFilterElement.Create(doc, "Thin Filter 2", typedCatList, rules)
	view.AddFilter(filter.Id)
	
except:
	pass

TransactionManager.Instance.TransactionTaskDone()

OUT = view
# ----------------------------------------
watch = Watch(python_script)
watch_2 = Watch(get_all_views.Engineering_Plans)
