# Dynamo graph Revit-ReferenceCurve.dyn (Dynamo 0.9.1.4062)

code_block = CodeBlock { 0; }
byCoordinates = ReferencePoint.ByCoordinates(x=code_block, y=code_block, z=code_block)
number_slider = DoubleSlider(6.4, range=0..10 step 0.1)
number_slider_2 = DoubleSlider(2.9, range=0..10 step 0.1)
number_slider_3 = DoubleSlider(7.9, range=0..10 step 0.1)
byCoordinates_2 = ReferencePoint.ByCoordinates(x=number_slider, y=number_slider_2, z=number_slider_3)
python_script = Python(IN[0]=byCoordinates, IN[1]=byCoordinates_2)
# ---------- python_script.python (15 lines) ----------
import clr
clr.AddReference("RevitNodes")
import Revit

from Revit.Elements import *
import System

start =IN [0]
end = IN[1]

refPtArray=System.Array[ReferencePoint]([start, end])


#Assign your output to the OUT variable.
OUT = CurveByPoints.ByReferencePoints(refPtArray)
# ----------------------------------------
