# Dynamo graph Revit-StructuralFraming-b.dyn (Dynamo 0.9.1.4062)

select_model_element = DSModelElementSelection()  # 1 picked in the model
select_model_element_2 = DSModelElementSelection()  # 1 picked in the model
number_slider = DoubleSlider(6, range=0..100 step 0.1)
code_block = CodeBlock(x=number_slider) { 0..1..#x; }
structural_framing_types = StructuralFramingTypes("W12X26")
levels = Levels("Level 1")
python_script = Python(IN[0]=select_model_element, IN[1]=select_model_element_2, IN[2]=code_block, IN[3]=structural_framing_types, IN[4]=levels)
# ---------- python_script.python (26 lines) ----------
import clr
#dynamo geometry
clr.AddReference('ProtoGeometry')
from Autodesk.DesignScript.Geometry import *
#import revit nodes
clr.AddReference("RevitNodes")
import Revit
from Revit.Elements import *
import System

crvA = IN[0].Curves[0]
crvB = IN[1].Curves[0]

framingType = IN[3]
designLevel = IN[4]

#Assign your output to the OUT variable.
OUT = []

for val in IN[2]:
	ptA = Curve.PointAtParameter(crvA,val)
	ptB = Curve.PointAtParameter(crvB,val)
	#dynamo line
	beamCrv = Line.ByStartPointEndPoint(ptA,ptB)
	#revit elements
	beam = StructuralFraming.BeamByCurve(beamCrv,designLevel,framingType)
# ----------------------------------------
geometry = Element.Geometry(select_model_element)
beamByCurve = StructuralFraming.BeamByCurve(curve=geometry, level=levels, structuralFramingType=structural_framing_types)
