# Dynamo graph STR_Plate Girder.dyn (Dynamo 0.9.1.4062)

# group: INPUT: FAMILY TYPE
family_types = FamilyTypes()

# group: INPUT: EXCEL FILES
file_path = Filename("C:\Users\giovanni.brogioli\Documents\Dynamo\STR_Plate Girder.xlsx")

fromPath = FileObject(file_path)  # "File.FromPath"
code_block = CodeBlock { "STR_Plate Girder"; }
readFromFile = Excel.ReadFromFile(file=fromPath, sheetName=code_block)
code_block_2 = CodeBlock { 0; }
getItemAtIndex = List.GetItemAtIndex(index=code_block_2)
map = List.Map(list=readFromFile, f_x=getItemAtIndex)
duplicate = Custom[FamilyType.Duplicate](family_type=family_types, name_s=map)  # Create duplicate family types with the specified name. If the type exists, it is called.
setParameterByName = Element.SetParameterByName(element=duplicate)
parameter_name = CodeBlock { {"tw","tft","tfb","d","bt","bb"}; }
fromPath_2 = FileObject(file_path)  # "File.FromPath"
code_block_3 = CodeBlock { "STR_Plate Girder"; }
readFromFile_2 = Excel.ReadFromFile(file=fromPath_2, sheetName=code_block_3)
transpose = List.Transpose(readFromFile_2)
element_creation_inputs = CodeBlock()
# ---------- element_creation_inputs.designscript (10 lines) ----------
//Name;
0;
//d;
1;
//b;
2;
//tft-tfb;
3;
//tw;
4;
# ----------------------------------------
web_thk = List.GetItemAtIndex(list=transpose, index=element_creation_inputs.out4)
top_flange_thk_bottom_flange_thk = List.GetItemAtIndex(list=transpose, index=element_creation_inputs.out3)
depth = List.GetItemAtIndex(list=transpose, index=element_creation_inputs.out1)
base = List.GetItemAtIndex(list=transpose, index=element_creation_inputs.out2)
create = List.Create(web_thk, top_flange_thk_bottom_flange_thk, top_flange_thk_bottom_flange_thk, depth, base, base)
combine = List.Combine(setParameterByName, parameter_name, create)

# group: INPUT: FILLED REGION
select_model_elements = DSModelElementsSelection()

code_block_4 = CodeBlock { 255; 0; }
byARGB = Color.ByARGB(r=code_block_4.out0, g=code_block_4.out1, b=code_block_4.out1)
byARGB_2 = Color.ByARGB(r=code_block_4.out1, g=code_block_4.out0, b=code_block_4.out1)
byARGB_3 = Color.ByARGB(r=code_block_4.out1, g=code_block_4.out1, b=code_block_4.out0)
create_2 = List.Create(byARGB, byARGB_2, byARGB_3)

# group: INPUT: Family
categories = Categories("StructuralFraming")

all_elements_of_category = ElementsOfCategory(categories)
count = Count(all_elements_of_category)
code_block_5 = CodeBlock(a=count) { 0..1..#a; }
color_range = ColorRange(create_2, arg2=code_block_5)
overrideColorInView = Element.OverrideColorInView(element=select_model_elements, color=color_range)

# group: INPUT: MODEL LINES
select_model_elements_2 = DSModelElementsSelection()

geometry = Element.Geometry(select_model_elements_2)
flatten = Flatten(geometry)

# group: INPUT: LEVEL
levels = Levels()

beamByCurve = StructuralFraming.BeamByCurve(curve=flatten, level=levels, structuralFramingType=duplicate)
watch = Watch(beamByCurve)
code_block_6 = CodeBlock { "Mark"; }
string_from_object = FromObject(beamByCurve)
code_block_7 = CodeBlock { ","; }
split = String.Split(string_from_object, code_block_7)
code_block_8 = CodeBlock { 1; }
getItemAtIndex_2 = List.GetItemAtIndex(index=code_block_8)
map_2 = List.Map(list=split, f_x=getItemAtIndex_2)
code_block_9 = CodeBlock { "="; }
split_2 = String.Split(map_2, code_block_9)
code_block_10 = CodeBlock { 1; }
getItemAtIndex_3 = List.GetItemAtIndex(index=code_block_10)
map_3 = List.Map(list=split_2, f_x=getItemAtIndex_3)
setParameterByName_2 = Element.SetParameterByName(element=select_model_elements, parameterName=code_block_6, value=map_3)
string = StringInput("")
overrideColorInView_2 = Element.OverrideColorInView(element=all_elements_of_category, color=color_range)
