# Dynamo graph Select-All-Elements-of-Category-Test-01.dyn (Dynamo 0.7.2.2114)

categories = Categories(index=894)
all_elements_of_category = ElementsOfCategory(categories)
watch = Watch(all_elements_of_category)
