# Dynamo graph Set-muliple-Parameters.dyn (Dynamo 0.9.1.4062)

categories = Categories("ElectricalEquipment")
all_elements_of_category = ElementsOfCategory(categories)
type = Custom[Element.Type](element_s=all_elements_of_category)  # Gets the family type of a given element (if applicable).
uniqueItems = List.UniqueItems(type)
setParameterByName = Element.SetParameterByName(element=uniqueItems, lacing=CrossProduct)

# group: Parameter names
parameter_name = CodeBlock()
# ---------- parameter_name.designscript (2 lines) ----------
{"Assembly Code","Cost","Description","Keynote",
"Manufacturer","Model","Type Comments"};
# ----------------------------------------

# group: Data to write
asembly_code = CodeBlock { {23,34,45,67,78,98,43,56,56}; }
string_from_object = FromObject(asembly_code)
cost = CodeBlock { {0,1,2,30,50,20,99,100,34}; }
description = CodeBlock()
# ---------- description.designscript (2 lines) ----------
{"Assembly Code","Cost","Description","Keynote",
"Manufacturer","Model","Type Comments","some test2","some text 3"};
# ----------------------------------------
keynote = CodeBlock { {"L23","L34","L45","L67","L78","L98","L43","G56","D65"}; }
manufacturer = CodeBlock { {"Manu1","Manu2","Manu3","Manu4","Manu15","Manu41","Manu5", "Manu444","Manu334"}; }
keynote_2 = CodeBlock { {"L23","L34","L45","L67","L78","L98","L43","G56","D65"}; }
description_2 = CodeBlock()  # same code as description

create = List.Create(string_from_object, cost, description, keynote, manufacturer, keynote_2, description_2)
combine = List.Combine(setParameterByName, parameter_name, create)
