# Dynamo graph Site A Tunnels.dyn (Dynamo 0.8.2.2392)

get_RhinoObjects = Interoperability.ReadRhino.RhinoObject.Get_RhinoObjects()
watch = Watch()
file_path = Filename("\\Global.arup.com\london\BEL\Jobs\120000\122100\122101 Astoria\4 Internal Data\11 3D Models\01 Third Party Models\Common\LUL & Crossrail tunnels\HAG-N105-8742-TUN-M-MOD-X-37201_BIND CB2.3dm")
fromPath = FileObject(file_path)  # "File.FromPath"
get_RhinoFile = Interoperability.ReadRhino.OpenRhino3dmModel.Get_RhinoFile(fromPath)
get_DocumentObjects = Interoperability.ReadRhino.RhinoObject.Get_DocumentObjects(get_RhinoFile)
rhino_AllGeometryToDS = Interoperability.ReadRhino.RhinoTranslationToDS.Rhino_AllGeometryToDS()
