# Dynamo graph Site B Column Framing Check.dyn (Dynamo 0.9.0.3067)

# group: Framing Locations
framing = DSModelElementsSelection()  # 25 picked in the model
location = StructuralFraming.Location(framing)
code_block = CodeBlock(curve1=location) { point1 = curve1.StartPoint; }
code_block_2 = CodeBlock(curve1=location) { point1 = curve1.EndPoint; }
watch = Watch(framing)

create = List.Create(code_block, code_block_2)

# group: Create Surface at Grid
select_model_element = DSModelElementSelection()  # 1 picked in the model
curve = Grid.Curve(select_model_element)
code_block_3 = CodeBlock { Vector.ByCoordinates(0,0,500000); }
extrude = Curve.Extrude(curve, code_block_3)

# group: Column Locations
columns = DSModelElementsSelection()  # 30 picked in the model
watch_2 = Watch(columns)
boundingBox = Element.BoundingBox(columns)
code_block_4 = CodeBlock(bb1=boundingBox)
# ---------- code_block_4.designscript (5 lines) ----------
cpt = bb1.ToCuboid().Centroid();
bpt = bb1.MinPoint.Z;
tpt = bb1.MaxPoint.Z;
bot = Autodesk.Point.ByCoordinates(cpt.X,cpt.Y,bpt);
top = Autodesk.Point.ByCoordinates(cpt.X,cpt.Y,tpt);
# ----------------------------------------

# group: Element Distance from Grid
distanceTo = Geometry.DistanceTo(geometry=create, other=extrude)
distanceTo_2 = Geometry.DistanceTo(geometry=code_block_4.cpt, other=extrude)
