# Dynamo graph StrFrmSlope.dyn (Dynamo 0.9.1.2865)

categories = Categories("StructuralFraming")
all_elements_of_category = ElementsOfCategory(categories)

# group: Reference Plane indicating the new slope
element_types = ElementTypes("ReferencePlane")
all_elements_of_type = ElementsOfType(element_types)
plane = ReferencePlane.Plane(all_elements_of_type)

code_block = CodeBlock(sf=all_elements_of_category, Pln=plane)
# ---------- code_block.designscript (6 lines) ----------
sfCr1=sf.Location;
sfCr2=Flatten(sfCr1<1>.Project(Pln,Vector.ZAxis()));
ofSt1=(sfCr2.StartPoint).Z-(sfCr1.StartPoint).Z;
ofEn1=(sfCr2.EndPoint).Z-(sfCr1.EndPoint).Z;
ofSt2=sf.SetParameterByName("Start Level Offset",ofSt1);
ofEn2=sf.SetParameterByName("End Level Offset",ofEn1);
# ----------------------------------------
