# Dynamo graph all elements category.dyn (Dynamo 1.0.0.1180)

get_type_list_for_this_project = Custom[Get Type List for this project]()
watch = Watch(get_type_list_for_this_project.FamilySymbols)
get_categories = Custom[Get Categories]()  # Lists: Category Name, Category internal api definition, Clean Name (no spaces), Ids
watch_2 = Watch(get_categories.Names)
boolean = BoolSelector(false)
watch_3 = Custom[Watch+](input=watch_2, reset=boolean)  # This node that serializes the input information and presents it in a resizable text window.
categories = Categories("Floors")
all_elements_of_category = ElementsOfCategory(categories)
watch_4 = Watch(all_elements_of_category)
built_in_name_lister = Custom[Built In Name Lister]()  # lists BuiltInNames (Built In Category Names)
does_this_document_contain = Custom[Does this Document Contain Category](builtInNames=built_in_name_lister.builtins)  # This iterates all BuiltInNames searching for elements on those categories. output CategoryList shows categories in this document.
watch_5 = Watch(does_this_document_contain.CategoryList)
code_block = CodeBlock { 158; }
getItemAtIndex = List.GetItemAtIndex(list=get_categories.Categories, index=code_block)
all_elements_of_category_2 = ElementsOfCategory(getItemAtIndex)
element_types = ElementTypes("Wall")
all_elements_of_type = ElementsOfType(element_types)
watch_6 = Watch(all_elements_of_type)
watch_7 = Watch(get_type_list_for_this_project.uniquified_flat_list)
watch_8 = Custom[Watch+](input=watch_7)
