# Dynamo graph loop.dyn (Dynamo 0.8.2.2392)

joinGeometry = Custom[Element.JoinGeometry](lacing=CrossProduct)  # Joins two model elements (if possible). Only works inside the project environment.
select_model_element = DSModelElementSelection()  # 1 picked in the model
select_model_elements = DSModelElementsSelection()  # 3 picked in the model
code_block = CodeBlock { 1; }
cycle_entries_of_one_list_by = Custom[Cycle Entries of one List by List of Lengths](listToCycle=select_model_elements, listOfLengths=code_block)
flatten = Flatten(cycle_entries_of_one_list_by)
code_block_2 = CodeBlock()
# ---------- code_block_2.designscript (17 lines) ----------
def Intersection(J:Function,num1:int,l1:var[],l2:var[])
{n=0;
m=0;
return = [Imperative]
{
 while(n<num1)
 {
 while(m<List.GetItemAtIndex(l1,n))
 {
 J.DoEvaluation(List.GetItemAtIndex(l2,n)).DoEvalutation(List.GetItemAtIndex(l2,m)
 m=m+1;
 }
 return = m;
 n=n+1;
 }
 return=n;
 }};
# ----------------------------------------
code_block_3 = CodeBlock {  }
code_block_4 = CodeBlock { {5,10}; }
python_script = Python(IN[0]=code_block_4)
# ---------- python_script.python (17 lines) ----------
import clr
clr.AddReference('ProtoGeometry')
from Autodesk.DesignScript.Geometry import *
#The inputs to this node will be stored as a list in the IN variables.
dataEnteringNode = IN

a = IN[0]

c = len(a)

b=[]

for i in range(0,c):
	b.append(a[i]+i)

#Assign your output to the OUT variable.
OUT = b
# ----------------------------------------
