# Dynamo graph lvel offset.dyn (Dynamo 1.0.0.1180)

select_model_element = DSModelElementSelection()
code_block = CodeBlock { "Reference Level"; "Start Level Offset"; "End Level Offset"; }
integer_slider = IntegerSlider(0, range=0..500 step 1)
setParameterByName = Element.SetParameterByName(element=select_model_element, parameterName=code_block.out1, value=integer_slider)
setParameterByName_2 = Element.SetParameterByName(element=select_model_element, parameterName=code_block.out2, value=integer_slider)
levels = Levels("Level 1")
setParameterByName_3 = Element.SetParameterByName(element=select_model_element, parameterName=code_block.out0, value=levels)
levels_2 = Levels("Level 2")
get_builtinparameter_name = ItemSelector(select_model_element)
select_model_element_2 = DSModelElementSelection()
get_builtinparameter_name_2 = ItemSelector(select_model_element_2)
select_model_element_3 = DSModelElementSelection()
curves = Element.Curves(select_model_element_3)
levels_3 = Levels("Level 1")
structural_framing_types = StructuralFramingTypes("RHS 80x40x8")
beamByCurve = StructuralFraming.BeamByCurve(curve=curves, level=levels_3, structuralFramingType=structural_framing_types)
get_builtinparameter_name_3 = ItemSelector("End Level Offset | STRUCTURAL_BEAM_END1_ELEVATION | double | ReadWrite", beamByCurve)
code_block_2 = CodeBlock { "Reference Level"; "Start Level Offset"; "End Level Offset"; }
setParameterByName_4 = Element.SetParameterByName(element=beamByCurve, parameterName=code_block_2.out2)
setParameterByName_5 = Element.SetParameterByName(parameterName=code_block_2.out1)
code_block_3 = CodeBlock { -100; }
setParameterByName_6 = Element.SetParameterByName(parameterName=code_block_2.out2, value=code_block_3)
select_model_element_4 = DSModelElementSelection()  # 1 picked in the model
code_block_4 = CodeBlock { "End Level Offset"; }
code_block_5 = CodeBlock { 100; }
setParameterByName_7 = Element.SetParameterByName(element=select_model_element_4, parameterName=code_block_4, value=code_block_5)
code_block_6 = CodeBlock { 0; }
setParameterByName_8 = Element.SetParameterByName(element=setParameterByName_7, parameterName=code_block_4, value=code_block_6)
get_builtinparameter_name_4 = ItemSelector()
watch = Watch(get_builtinparameter_name_4)
code_block_7 = CodeBlock { "Offset"; }
get_built_in_parameter = Custom[Get Built In Parameter](ParameterNames=get_builtinparameter_name_4)  # This node will take an input of a built in parameter name and element to return that parameters value.
set_builtin_parameter = Custom[Set BuiltIn Parameter]()  # This node will take an input of a built in parameter name and set that parameter to given value for given elements.
select_model_element_5 = DSModelElementSelection()
code_block_8 = CodeBlock { "Level"; }
levels_4 = Levels("Level 1")
setParameterByName_9 = Element.SetParameterByName(element=select_model_element_5, parameterName=code_block_8, value=levels_4)
levels_5 = Levels("Level 2")
setParameterByName_10 = Element.SetParameterByName(element=setParameterByName_9, parameterName=code_block_8, value=levels_5)
transform = Vector.Transform()
select_model_element_6 = DSModelElementSelection()
plane = ReferencePlane.Plane(select_model_element_6)
code_block_9 = CodeBlock { 0; }
code_block_10 = CodeBlock { 5000; }
translate = Geometry.Translate(geometry=plane, xTranslation=code_block_9, yTranslation=code_block_9, zTranslation=code_block_10)
code_block_11 = CodeBlock { 0; }
code_block_12 = CodeBlock { 2000; }
select_model_element_7 = DSModelElementSelection()
geometry = Element.Geometry(select_model_element_7)
select_model_element_8 = DSModelElementSelection()
get_builtinparameter_name_5 = ItemSelector("Apparent Load | INVALID | double | ReadWrite", select_model_element_8)
categories = Categories("MechanicalEquipment")
all_elements_of_category = ElementsOfCategory(categories)
code_block_13 = CodeBlock(sf=all_elements_of_category, Pln=plane)
# ---------- code_block_13.designscript (4 lines) ----------
sfCr1=sf.Location;
sfCr2=Flatten(sfCr1<1>.Project(Pln,Vector.ZAxis()));
ofSt1=(sfCr2.Z)-(sfCr1.Z);
sf.SetParameterByName("Offset",ofSt1);
# ----------------------------------------
watch_2 = Watch(code_block_13.sfCr2)
watch_3 = Watch(code_block_13.ofSt1)
watch_4 = Watch(code_block_13.sfCr1)
code_block_14 = CodeBlock(a=watch_4) { a.Z; }
select_model_element_9 = DSModelElementSelection()  # 1 picked in the model
plane_2 = ReferencePlane.Plane(select_model_element_9)
code_block_15 = CodeBlock(Pln=plane_2) { Flatten(sfCr1<1>.Project(Pln,Vector.ZAxis())); }
