# Dynamo graph lvel offset3.dyn (Dynamo 1.0.0.1180)

select_mep_element = DSModelElementSelection()  # 1 picked in the model
location = FamilyInstance.Location(select_mep_element)
code_block = CodeBlock { 0; }
byCoordinates = Vector.ByCoordinates(z=code_block)
add = Point.Add(point=location, vectorToAdd=byCoordinates)
setLocation = Custom[Element.SetLocation](element_s=select_mep_element, location_s=add)  # Attempts to modify the location of the input element. This can effectively add as a move comand in Revit. Works for both line based and point based elements.
select_mep_element_2 = DSModelElementSelection()  # 1 picked in the model
select_ref_plane_destination = DSModelElementSelection()  # 1 picked in the model
plane = ReferencePlane.Plane(select_ref_plane_destination)
code_block_2 = CodeBlock(sf=select_mep_element_2, Pln=plane)
# ---------- code_block_2.designscript (4 lines) ----------
sfCr1=sf.Location;
sfCr2=Flatten(sfCr1<1>.Project(Pln,Vector.ZAxis()));
ofSt1=(sfCr2.Z)-(sfCr1.Z);
sf.SetParameterByName("Offset",ofSt1);
# ----------------------------------------
select_mep_element_3 = DSModelElementSelection()  # 1 picked in the model
code_block_3 = CodeBlock { "Level"; }
levels = Levels("Level 3")
setParameterByName = Element.SetParameterByName(element=select_mep_element_3, parameterName=code_block_3, value=levels)
code_block_4 = CodeBlock { 0; }
location_2 = FamilyInstance.Location()
family_types = FamilyTypes("Air Compressor - 8-10 kW:37 kW 8 bar")
byPoint = FamilyInstance.ByPoint(familyType=family_types)
