# Dynamo graph ovverride colors.dyn (Dynamo 0.9.1.4062)

code_block = CodeBlock { Flatten({item}); }
string = StringInput("Solid fill")
code_block_2 = CodeBlock { true; }
fill_pattern = Custom[Fill Pattern](Name=string, Drafting_Modeling=code_block_2)  # Get Fill Pattern by Name
python_script = Python(IN[0]=code_block, IN[1]=fill_pattern)
# ---------- python_script.python (58 lines) ----------
# Created by DPSDesign, dpsdesign.org
import clr
clr.AddReference('ProtoGeometry')
from Autodesk.DesignScript.Geometry import *

# Import ToDSType(bool) extension method
clr.AddReference("RevitNodes")
import Revit
clr.ImportExtensions(Revit.Elements)

# Import DocumentManager and TransactionManager
clr.AddReference("RevitServices")
import RevitServices
from RevitServices.Persistence import DocumentManager
from RevitServices.Transactions import TransactionManager

from System.Collections.Generic import *

# Import RevitAPI
clr.AddReference("RevitAPI")
import Autodesk

doc = DocumentManager.Instance.CurrentDBDocument
uiapp = DocumentManager.Instance.CurrentUIApplication
app = uiapp.Application

#The inputs to this node will be stored as a list in the IN variable.
dataEnteringNode = IN

#unwrap all elements to use with API
elements = []
for i in IN[0]:
	elements.append(UnwrapElement(i))


patts = UnwrapElement(IN[1])
#for patt in IN[1]:
#	patts.append(UnwrapElement(patt))

#create graphic overrides properties
gSettings = Autodesk.Revit.DB.OverrideGraphicSettings()
#deconstruct DS Color Object and convert to RevitAPI color

gSettings.SetProjectionFillPatternId(patts.Id)

# "Start" the transaction
TransactionManager.Instance.EnsureInTransaction(doc)

#apply color override to elements in an input list
for i in elements:
	id = i.Id
	doc.ActiveView.SetElementOverrides(id, gSettings)

# "End" the transaction
TransactionManager.Instance.TransactionTaskDone()

#Assign your output to the OUT variable
OUT = IN[0]
# ----------------------------------------
family_types = FamilyTypes("00:00")
all_elements_of_family_type = ElementsOfFamilyType(family_types)
code_block_3 = CodeBlock { 100; }
code_block_4 = CodeBlock { 0; }
byARGB = Color.ByARGB(r=code_block_3, g=code_block_3, b=code_block_4)
override_fill_pattern_in_view = Custom[Override Fill Pattern in View](Element=all_elements_of_family_type, Color=byARGB, fillPattern=fill_pattern)  # Overrides fill pattern of any element in an active view to specified fill pattern and color
watch = Watch()
categories = Categories("StructuralFraming")
all_elements_of_category = ElementsOfCategory(categories)
python_script_2 = Python()
# ---------- python_script_2.python (58 lines) ----------
# Created by DPSDesign, dpsdesign.org
import clr
clr.AddReference('ProtoGeometry')
from Autodesk.DesignScript.Geometry import *

# Import ToDSType(bool) extension method
clr.AddReference("RevitNodes")
import Revit
clr.ImportExtensions(Revit.Elements)

# Import DocumentManager and TransactionManager
clr.AddReference("RevitServices")
import RevitServices
from RevitServices.Persistence import DocumentManager
from RevitServices.Transactions import TransactionManager

from System.Collections.Generic import *

# Import RevitAPI
clr.AddReference("RevitAPI")
import Autodesk

doc = DocumentManager.Instance.CurrentDBDocument
uiapp = DocumentManager.Instance.CurrentUIApplication
app = uiapp.Application

#The inputs to this node will be stored as a list in the IN variable.
dataEnteringNode = IN

#unwrap all elements to use with API
elements = []
for i in IN[0]:
	elements.append(UnwrapElement(i))

#create graphic overrides properties
gSettings = Autodesk.Revit.DB.OverrideGraphicSettings()
#deconstruct DS Color Object and convert to RevitAPI color
dsColor = IN[1]
colRed = dsColor.Red
colGreen = dsColor.Green
colBlue = dsColor.Blue
color = Autodesk.Revit.DB.Color(colRed, colGreen, colBlue)
#set Projection Line color
gSettings.SetProjectionFillColor(color)

# "Start" the transaction
TransactionManager.Instance.EnsureInTransaction(doc)

#apply color override to elements in an input list
for i in elements:
	id = i.Id
	doc.ActiveView.SetElementOverrides(id, gSettings)

# "End" the transaction
TransactionManager.Instance.TransactionTaskDone()

#Assign your output to the OUT variable
OUT = IN[0]
# ----------------------------------------
