# Dynamo graph python element ouput.dyn (Dynamo 0.9.1.4062)

floor_types = FloorTypes("Floor 1")
categories = Categories("Floors")
watch = Watch(categories)
all_elements_of_category = ElementsOfCategory(watch)
watch_2 = Watch(all_elements_of_category)
categories_2 = Categories("Floors")
all_elements_of_category_2 = ElementsOfCategory(categories_2)
python_script = Python()
# ---------- python_script.python (16 lines) ----------
import clr

clr.AddReference('RevitAPI')
from Autodesk.Revit.DB import *

clr.AddReference('RevitServices')
import RevitServices
from RevitServices.Persistence import DocumentManager
from RevitServices.Transactions import TransactionManager

doc = DocumentManager.Instance.CurrentDBDocument

coll = FilteredElementCollector( doc )
coll.WherePasses(LogicalOrFilter(ElementIsElementTypeFilter( False ),ElementIsElementTypeFilter( True )))

OUT = [e.Id for e in coll]
# ----------------------------------------
watch_3 = Watch(python_script)
boolean = BoolSelector(true)
active_view = Custom[Active View](refresh=boolean)  # Selects the current document's active view. Supports more view types than the built-in option. Will be depreciated once the bult in node works with all plan types.
python_script_2 = Python(IN[1]=active_view)
# ---------- python_script_2.python (46 lines) ----------
import clr
clr.AddReference('ProtoGeometry')
from Autodesk.DesignScript.Geometry import *

clr.AddReference("RevitServices")
import RevitServices
from RevitServices.Persistence import DocumentManager

clr.AddReference("RevitAPI")
import Autodesk
from Autodesk.Revit.DB import *

clr.AddReference("RevitNodes")
import Revit
clr.ImportExtensions(Revit.Elements)




doc = DocumentManager.Instance.CurrentDBDocument

current = UnwrapElement(IN[1]).Id

cat = doc.Settings.Categories.get_Item(BuiltInCategory.OST_Floors)


collector = FilteredElementCollector(doc).OfCategory(BuiltInCategory.OST_Floors)

coll = FilteredElementCollector(doc, current).WhereElementIsNotElementType().OfCategory(BuiltInCategory.OST_StructuralColumns)

list = []

catalist = []


for i in coll:
	list.append(i)

 

#Assign your output to the OUT variable.
#OUT = coll.ToElementIds()
#OUT = [i.Category for i in coll]
#OUT = [(i.Name) for i in doc.Settings.Categories]
#OUT = coll
OUT = list
# ----------------------------------------
watch_4 = Watch(python_script_2)
code_block = CodeBlock { 0; }
getItemAtIndex = List.GetItemAtIndex(index=code_block)
map = List.Map(list=watch_4, f_x=getItemAtIndex)
all_elements_in_active_view = ElementsInView()
code_block_2 = CodeBlock { "Floors"; }
byCategoryName = Custom[Filter.ByCategoryName](element_s=all_elements_in_active_view, category_name_s=code_block_2)  # Filters the input elements by their category name. You can input multiple category names.
watch_5 = Watch(byCategoryName.in)
watch_6 = Watch(watch_4)
name = Element.Name(python_script_2)
