# Dynamo graph set level.dyn (Dynamo 0.9.1.4062)

code_block = CodeBlock { "Level 3"; }
get_level_by_name = Custom[Get Level by Name](Level_Name=code_block)  # This node will retrieve a Revit Level Element by its name.
select_model_element = DSModelElementSelection()  # 1 picked in the model
code_block_2 = CodeBlock { "Reference Level"; "Start Level Offset"; "End Level Offset"; }
getParameterValueByName = Element.GetParameterValueByName(element=select_model_element, parameterName=code_block_2.out1)
integer_slider = IntegerSlider(0, range=0..100 step 1)
setParameterByName = Element.SetParameterByName(element=select_model_element, parameterName=code_block_2.out1, value=integer_slider)
setParameterByName_2 = Element.SetParameterByName(element=select_model_element, parameterName=code_block_2.out2, value=integer_slider)
code_block_3 = CodeBlock { "Work Plane"; }
string = StringInput("Reference Level")
categories = Categories("StructuralFraming")
all_elements_of_category = ElementsOfCategory(categories)
get_built_in_parameter = Custom[Get Built In Parameter](ParameterNames=string, Elements=all_elements_of_category)  # This node will take an input of a built in parameter name and element to return that parameters value.
set_builtin_parameter = Custom[Set BuiltIn Parameter](ParameterName=string)  # This node will take an input of a built in parameter name and set that parameter to given value for given elements.
code_block_4 = CodeBlock { "Level"; }
level = Custom[Element.Level](element=select_model_element)  # Gets an element's level
type = Custom[Element.Type](element=select_model_element)  # Gets the family type of a given element (if applicable).
listBuiltInParameters = Custom[Document.ListBuiltInParameters]()  # List all the available BuiltInParameters
levels = Levels("Level 1")
all_framing_at_reference_level = Custom[All Framing at Reference Level](Level=levels)  # Collects all of the structural framing at a specific reference level
string_2 = StringInput("Level")
levels_2 = Levels("Level 3")
setparameterbyname = Custom[SetParameterByName(TypeOrInstance)](element=all_framing_at_reference_level, parameterName=string_2, value=levels_2)  # Set one of the element's parameters regardless of parameter type or instance.
code_block_5 = CodeBlock { 100; }
family_types = FamilyTypes("UB-Universal Beams:UB914x305x253")
all_elements_of_family_type = ElementsOfFamilyType(family_types)
code_block_6 = CodeBlock { "Width"; }
select_model_elements = DSModelElementsSelection()  # 2 picked in the model
get_built_in_parameter_2 = Custom[Get Built In Parameter](ParameterNames=code_block_6, Elements=select_model_elements)
get_type_parameter = Custom[Get Type Parameter]()  # This node will retrieve a type parameter by its name.
familyType = Custom[FamilyInstance.FamilyType]()  # This node will return a Family Type of a given Family Instance. If no Family Type can be assigned to a Family then it will return Null.
parameter_group = Custom[Parameter Group]()  # This node will return all available Parameter Groups
get_type_parameter_2 = Custom[Get Type Parameter](element=select_model_elements, parameterName=code_block_6)
