# Dynamo graph while.dyn (Dynamo 0.9.1.4062)

code_block = CodeBlock { 5; }
python_script = Python(IN[0]=code_block)
# ---------- python_script.python (19 lines) ----------
import clr
clr.AddReference('ProtoGeometry')
from Autodesk.DesignScript.Geometry import *
#The inputs to this node will be stored as a list in the IN variables.
dataEnteringNode = IN

a = IN[0]

count = 0

c=[]

while (count<a):
	c = count+1;
	if count==a:
		break

#Assign your output to the OUT variable.
OUT = c
# ----------------------------------------
code_block_2 = CodeBlock(a=python_script) { a+5; }
