# Dynamo graph tst.dyn (Dynamo 1.3.1.1736)

categories = Categories("StructuralColumns")
all_elements_of_category = ElementsOfCategory(categories)
code_block = CodeBlock(a=all_elements_of_category) { a[0]; }
geometry = Element.Geometry(code_block)
select_model_element = DSModelElementSelection()  # 1 picked in the model
