# Dynamo graph ui_test.dyn (Dynamo 1.3.1.1736)

# group: systems
code_block = CodeBlock { 1..10; }
code_block_2 = CodeBlock(a=code_block) { "System"+a; }

# group: linetypes
code_block_3 = CodeBlock { {"Type A", "Type B"}; }

ui_dropdown_data = Custom[UI.DropDown Data](InputName=code_block_2, Keys=code_block_3, Values=code_block_2)  # Create data for DropDown input in UI.MultiInputForm ++ . Check out www.data-shapes.net for more infos.
boolean = BoolSelector(true)
ui_multipleinputform = Custom[UI.MultipleInputForm ++](Inputs=ui_dropdown_data, Toggle=boolean)  # Create a form with multiple inputs. see www.data-shapes.net for tutorials and infos!
