# Dynamo graph AForge Image.dyn (Dynamo 1.2.0.2514)

file_path = Filename("C:\Users\giovanni.brogioli\Downloads\ZeroTouchImages\grid.jpg")
fromPath = FileObject(file_path)  # "File.FromPath"
readFromFile = Image.ReadFromFile(fromPath)
watch_image = WatchImageCore(readFromFile)
blobCounter = AForge.Imaging.BlobCounter.BlobCounter(readFromFile)
getObjectsRectangles = AForge.Imaging.BlobCounterBase.GetObjectsRectangles(blobCounter)
python_script = Python(IN[0]=getObjectsRectangles)
# ---------- python_script.python (5 lines) ----------
rectangles=IN[0]
OUT=[]
for rec in rectangles:
 if rec.Width>8 and rec.Height>8:
  OUT.append(rec)
# ----------------------------------------
python_script_2 = Python(IN[0]=python_script)
# ---------- python_script_2.python (8 lines) ----------
OUT = []
for rec in IN[0]:
    subOUT=[]
    subOUT.append(rec.X)
    subOUT.append(rec.Y)
    subOUT.append(rec.Width)
    subOUT.append(rec.Height)
    OUT.append(subOUT)
# ----------------------------------------
transpose = List.Transpose(python_script_2)
code_block = CodeBlock(recData=transpose)
# ---------- code_block.designscript (11 lines) ----------
recData;
x0=List.GetItemAtIndex(recData,0);
y0=List.GetItemAtIndex(recData,1);
width=List.GetItemAtIndex(recData,2);
height=List.GetItemAtIndex(recData,3);
x1=x0+width;
y1=y0+height;
p0=Autodesk.Point.ByCoordinates(x0,y0);
p1=Autodesk.Point.ByCoordinates(x0,y1);
p2=Autodesk.Point.ByCoordinates(x1,y1);
p3=Autodesk.Point.ByCoordinates(x1,y0);
# ----------------------------------------
byCornerPoints = Rectangle.ByCornerPoints(code_block.p0, code_block.p1, code_block.p2, code_block.p3)
code_block_2 = CodeBlock { 50; }
extrudeAsSolid = Curve.ExtrudeAsSolid(byCornerPoints, code_block_2)
code_block_3 = CodeBlock { 0; 255; }
byARGB = Color.ByARGB(r=code_block_3.out1, g=code_block_3.out0, b=code_block_3.out0)
byARGB_2 = Color.ByARGB(r=code_block_3.out0, g=code_block_3.out1, b=code_block_3.out1)
create = List.Create(byARGB, byARGB_2)
volume = Solid.Volume(extrudeAsSolid)
code_block_4 = CodeBlock { 0; }
code_block_5 = CodeBlock { 1; }
remapRange = Math.RemapRange(numbers=volume, newMin=code_block_4, newMax=code_block_5)
color_range = ColorRange(create, arg2=remapRange)  # unwired: arg1
byGeometryColor = Display.Display.ByGeometryColor(extrudeAsSolid, color_range, lacing=Longest)
