# Dynamo graph Design script.dyn (Dynamo 1.2.0.2514)

code_block = CodeBlock()
# ---------- code_block.designscript (8 lines) ----------
[Imperative]{
num_per_lines=5;
result=[];
for (i in 0..num_per_lines){
 a=result.append(i);
return = result;
};
};
# ----------------------------------------
code_block_2 = CodeBlock()
# ---------- code_block_2.designscript (8 lines) ----------
[Imperative]{
num_per_lines=5;
result = {};
for (i in 0..num_per_lines){
 a=result.append(i);
return = result;
};
};
# ----------------------------------------
code_block_3 = CodeBlock { 6; }
code_block_4 = CodeBlock(code_block_3)
# ---------- code_block_4.designscript (10 lines) ----------
num_per_lines;
newlist = {};
[Imperative]
{
for (i in 0..num_per_lines)
{
newlist[i]=i;
}
}
b = newlist;
# ----------------------------------------
code_block_5 = CodeBlock { 5; }
code_block_6 = CodeBlock()
# ---------- code_block_6.designscript (11 lines) ----------
a= {};
 // declare an empty collection at the global scope;
[Imperative]
{
 for(i in 0..5) // for loop
 {
 a[i] = i;
 }
}
b = a;
 // b = {0, 1, 2, 3, 4, 5};
# ----------------------------------------
code_block_7 = CodeBlock { Autodesk.Point.ByCoordinates(0,0,0); }
code_block_8 = CodeBlock { Autodesk.Point.ByCoordinates(0,5,0); }
code_block_9 = CodeBlock(a=code_block_7, b=code_block_8) { Line.ByStartPointEndPoint(a,b); }
code_block_10 = CodeBlock { Autodesk.Point.ByCoordinates(0,10,0); }
code_block_11 = CodeBlock(a=code_block_7, b=code_block_10) { Line.ByStartPointEndPoint(a,b); }
create = List.Create(code_block_9, code_block_11)
intersectAll = Geometry.IntersectAll(geometry=create, others=code_block_7, lacing=Longest)
code_block_12 = CodeBlock(create)
# ---------- code_block_12.designscript (11 lines) ----------
num_per_lines=Count(a);
newlist = {};
[Imperative]
{
for (i in 0..num_per_lines)
{
newlist[i]=i;
geometry1 = t1.IntersectAll(point3);
}
}
b = newlist;
# ----------------------------------------
code_block_13 = CodeBlock()
# ---------- code_block_13.designscript (11 lines) ----------
point3 = Autodesk.Point.ByCoordinates(0, 0, 0);
point1 = Autodesk.Point.ByCoordinates(0, 5, 0);
a = point3;
b = point1;
line1 = Line.ByStartPointEndPoint(a, b);
point2 = Autodesk.Point.ByCoordinates(0, 10, 0);
a1 = point3;
b1 = point2;
line2 = Line.ByStartPointEndPoint(a1, b1);
t1 = {line1, line2};
geometry1 = t1<1L>.IntersectAll(point3<1L>);
# ----------------------------------------
code_block_14 = CodeBlock(create)
# ---------- code_block_14.designscript (10 lines) ----------
num_per_lines;
newlist = {};
[Imperative]
{
for (item in num_per_lines)
{
newlist[i]=item;
}
}
b = newlist;
# ----------------------------------------
code_block_15 = CodeBlock()
# ---------- code_block_15.designscript (7 lines) ----------
[Imperative]
{
 a=10;
 b=a*2;
 a=15;
 return = b;
};
# ----------------------------------------
watch = Watch()  # unwired: arg0
watch_2 = Watch()  # unwired: arg0
code_block_16 = CodeBlock { 5; }
code_block_17 = CodeBlock { 10; }
